# Grasshopper definition HG.◯◯⚪◯◯⦿◯◯⚪◯◯ⵙ◯◯⚪◯◯⦿◯◯⚪◯◯.GH (Grasshopper 0.9.76)

number_slider = Slider(0.5, range=0..1)

division = Division(A=number_slider, B=3)
circle = Circle(Plane=PlaneXY(0, 0, 0), Radius=number_slider)
sphere = Sphere(Base=PlaneXY(0, 0, 0), Radius=division)

multiplication = Multiplication(A=division, B=2)
circle_2 = Circle(Plane=PlaneXY(0, 0, 0), Radius=multiplication)
division_2 = Division(A=multiplication, B=6)
pipe = Pipe(Curve=circle_2, Radius=division_2, Caps=0)

multiplication_2 = Multiplication(A=division_2, B=2)
division_3 = Division(A=division_2, B=3)

addition = Addition(A=multiplication, B=multiplication_2)
circle_3 = Circle(Plane=PlaneXY(0, 0, 0), Radius=addition)
pipe_2 = Pipe(Curve=circle_3, Radius=division_3, Caps=0)

subtraction = Subtraction(A=multiplication, B=multiplication_2)
circle_4 = Circle(Plane=PlaneXY(0, 0, 0), Radius=subtraction)
pipe_3 = Pipe(Curve=circle_4, Radius=division_3, Caps=0)

multiplication_3 = Multiplication(A=division_3, B=2)
division_4 = Division(A=division_3, B=3)

subtraction_2 = Subtraction(A=addition, B=multiplication_3)
circle_5 = Circle(Plane=PlaneXY(0, 0, 0), Radius=subtraction_2)
pipe_4 = Pipe(Curve=circle_5, Radius=division_4, Caps=0)

addition_2 = Addition(A=addition, B=multiplication_3)
circle_6 = Circle(Plane=PlaneXY(0, 0, 0), Radius=addition_2)
pipe_5 = Pipe(Curve=circle_6, Radius=division_4, Caps=0)

addition_3 = Addition(A=subtraction, B=multiplication_3)
circle_7 = Circle(Plane=PlaneXY(0, 0, 0), Radius=addition_3)
pipe_6 = Pipe(Curve=circle_7, Radius=division_4, Caps=0)

subtraction_3 = Subtraction(A=subtraction, B=multiplication_3)
circle_8 = Circle(Plane=PlaneXY(0, 0, 0), Radius=subtraction_3)
pipe_7 = Pipe(Curve=circle_8, Radius=division_4, Caps=0)

multiplication_4 = Multiplication(A=division_4, B=2)
division_5 = Division(A=division_4, B=3)

addition_4 = Addition(A=addition_2, B=multiplication_4)
circle_9 = Circle(Plane=PlaneXY(0, 0, 0), Radius=addition_4)
pipe_8 = Pipe(Curve=circle_9, Radius=division_5, Caps=0)

subtraction_4 = Subtraction(A=addition_2, B=multiplication_4)
circle_10 = Circle(Plane=PlaneXY(0, 0, 0), Radius=subtraction_4)
pipe_9 = Pipe(Curve=circle_10, Radius=division_5, Caps=0)

addition_5 = Addition(A=subtraction_2, B=multiplication_4)
circle_11 = Circle(Plane=PlaneXY(0, 0, 0), Radius=addition_5)
pipe_10 = Pipe(Curve=circle_11, Radius=division_5, Caps=0)

addition_6 = Addition(A=addition_3, B=multiplication_4)
circle_12 = Circle(Plane=PlaneXY(0, 0, 0), Radius=addition_6)
pipe_11 = Pipe(Curve=circle_12, Radius=division_5, Caps=0)

subtraction_5 = Subtraction(A=addition_3, B=multiplication_4)
circle_13 = Circle(Plane=PlaneXY(0, 0, 0), Radius=subtraction_5)
pipe_12 = Pipe(Curve=circle_13, Radius=division_5, Caps=0)

addition_7 = Addition(A=subtraction_3, B=multiplication_4)
circle_14 = Circle(Plane=PlaneXY(0, 0, 0), Radius=addition_7)
pipe_13 = Pipe(Curve=circle_14, Radius=division_5, Caps=0)

subtraction_6 = Subtraction(A=subtraction_2, B=multiplication_4)
circle_15 = Circle(Plane=PlaneXY(0, 0, 0), Radius=subtraction_6)
pipe_14 = Pipe(Curve=circle_15, Radius=division_5, Caps=0)

subtraction_7 = Subtraction(A=subtraction_3, B=multiplication_4)
circle_16 = Circle(Plane=PlaneXY(0, 0, 0), Radius=subtraction_7)
pipe_15 = Pipe(Curve=circle_16, Radius=division_5, Caps=0)
