# Grasshopper definition XHG....ⵙᔓᔕⵙᗱᗴⵙᙁⵙᑐᑕⵙᴥⵙꖴⵙᑐᑕⵙ◯ⵙ✤ⵙИNⵙᗱᗴⵙᕤᕦⵙИNⵙᗩⵙ✤ⵙ◯ⵙᙁⵙᗩⵙꖴⵙᗝⵙᗩⵙᴥⵙ⊚ⵙ◌ⵙ⊚ⵙ◌ⵙ⊚ⵙ◌ⵙ⚪ⵙ◯ⵙ◯ⵙ⚪ⵙ◌ⵙ⊚ⵙ◌ⵙ⊚ⵙ◌ⵙ⊚ⵙᴥⵙᗩⵙᗝⵙꖴⵙᗩⵙᙁⵙ◯ⵙ✤ⵙᗩⵙИNⵙᕤᕦⵙᗱᗴⵙИNⵙ✤ⵙ◯ⵙᑐᑕⵙꖴⵙᴥⵙᑐᑕⵙᙁⵙᗱᗴⵙᔓᔕⵙ....GHX (Grasshopper 1.0.7)
# plug-ins: Palette, Anemone, BullAnt, BubalusGH2.0, GraphicPlus, Pufferfish, MeshEdit Components, NGon, Weaverbird

O = DigitScroller(Scroller_Digits=12, Scroller_Prefix="O", Scroller_Radix=11, Scroller_Value=2)
expression = Expression(Expression="SQRT(.5)/2")
multiplication = Multiplication(A=O, B=2)
division = Division(A="100", B=multiplication)
expression_2 = Expression(O=multiplication, Expression="1-2/O")
digit_scroller = DigitScroller(Scroller_Digits=12, Scroller_Prefix=" ", Scroller_Radix=1, Scroller_Value=8)
digit_scroller_2 = DigitScroller(Scroller_Digits=12, Scroller_Prefix=" ", Scroller_Radix=7, Scroller_Value=0)
digit_scroller_3 = DigitScroller(Scroller_Digits=12, Scroller_Prefix=" ", Scroller_Radix=1, Scroller_Value=7)
digit_scroller_4 = DigitScroller(Scroller_Digits=12, Scroller_Prefix=" ", Scroller_Radix=6, Scroller_Value=0)
digit_scroller_5 = DigitScroller(Scroller_Digits=12, Scroller_Prefix=" ", Scroller_Radix=1, Scroller_Value=6)
digit_scroller_6 = DigitScroller(Scroller_Digits=12, Scroller_Prefix=" ", Scroller_Radix=6, Scroller_Value=0)
digit_scroller_7 = DigitScroller(Scroller_Digits=12, Scroller_Prefix=" ", Scroller_Radix=1, Scroller_Value=5)
digit_scroller_8 = DigitScroller(Scroller_Digits=12, Scroller_Prefix=" ", Scroller_Radix=5, Scroller_Value=0)
digit_scroller_9 = DigitScroller(Scroller_Digits=12, Scroller_Prefix=" ", Scroller_Radix=1, Scroller_Value=4)
digit_scroller_10 = DigitScroller(Scroller_Digits=12, Scroller_Prefix=" ", Scroller_Radix=5, Scroller_Value=0)
digit_scroller_11 = DigitScroller(Scroller_Digits=12, Scroller_Prefix=" ", Scroller_Radix=1, Scroller_Value=3)
digit_scroller_12 = DigitScroller(Scroller_Digits=12, Scroller_Prefix=" ", Scroller_Radix=4, Scroller_Value=0)
digit_scroller_13 = DigitScroller(Scroller_Digits=12, Scroller_Prefix=" ", Scroller_Radix=1, Scroller_Value=2)
digit_scroller_14 = DigitScroller(Scroller_Digits=12, Scroller_Prefix=" ", Scroller_Radix=4, Scroller_Value=0.02)
digit_scroller_15 = DigitScroller(Scroller_Digits=12, Scroller_Prefix=" ", Scroller_Radix=1, Scroller_Value=1)
digit_scroller_16 = DigitScroller(Scroller_Digits=12, Scroller_Prefix=" ", Scroller_Radix=3, Scroller_Value=0.4)
digit_scroller_17 = DigitScroller(Scroller_Digits=12, Scroller_Prefix=" ", Scroller_Radix=1, Scroller_Value=0)
digit_scroller_18 = DigitScroller(Scroller_Digits=12, Scroller_Prefix=" ", Scroller_Radix=3, Scroller_Value=0.19)
digit_scroller_19 = DigitScroller(Scroller_Digits=12, Scroller_Prefix=" ", Scroller_Radix=11, Scroller_Value=8)
digit_scroller_20 = DigitScroller(Scroller_Digits=12, Scroller_Prefix=" ", Scroller_Radix=2, Scroller_Value=0)
subtraction = Subtraction(A=digit_scroller_19, B="1")
construct_point = ConstructPoint(XCoordinate=0, YCoordinate=expression, ZCoordinate=expression)
line_sdl = LineSDL(Start=construct_point, Direction=Vector(1, 0, 0), Length=expression)
colour_swatch = ColourSwatch(SwatchColor=RGB(255, 255, 255))
colour_swatch_2 = ColourSwatch(SwatchColor=RGB(227, 227, 227))
colour_swatch_3 = ColourSwatch(SwatchColor=RGB(115, 115, 115))
colour_swatch_4 = ColourSwatch(SwatchColor=RGB(209, 209, 209))
colour_swatch_5 = ColourSwatch(SwatchColor=RGB(222, 222, 222))
colour_swatch_6 = ColourSwatch(SwatchColor=RGB(168, 168, 168))
palette = Palette(
    ModeCustomStandard=True,
    Component_Normal_Deselected_Fill_Color=colour_swatch,
    Component_Normal_Deselected_Edge_Color=colour_swatch_4,
    Component_Normal_Deselected_Text_Color=colour_swatch_3,
    Component_Normal_Selected_Fill_Color=colour_swatch_2,
    Component_Normal_Selected_Edge_Color=colour_swatch_4,
    Component_Normal_Selected_Text_Color=colour_swatch_3,
    Component_Hidden_Deselected_Fill_Color=colour_swatch,
    Component_Hidden_Deselected_Edge_Color=colour_swatch_4,
    Component_Hidden_Deselected_Text_Color=colour_swatch_3,
    Component_Hidden_Selected_Fill_Color=colour_swatch_2,
    Component_Hidden_Selected_Edge_Color=colour_swatch_4,
    Component_Hidden_Selected_Text_Color=colour_swatch_3,
    Component_Disabled_Deselected_Fill_Color=ColourSwatch(SwatchColor=RGB(196, 196, 196)),
    Component_Disabled_Deselected_Edge_Color=colour_swatch_4,
    Component_Disabled_Deselected_Text_Color=colour_swatch_3,
    Component_Disabled_Selected_Fill_Color=ColourSwatch(SwatchColor=RGB(176, 176, 176)),
    Component_Disabled_Selected_Edge_Color=colour_swatch_4,
    Component_Disabled_Selected_Text_Color=colour_swatch_3,
    Component_Warning_Deselected_Fill_Color=colour_swatch,
    Component_Warning_Deselected_Edge_Color=colour_swatch_4,
    Component_Warning_Deselected_Text_Color=colour_swatch_3,
    Component_Warning_Selected_Fill_Color=colour_swatch_2,
    Component_Warning_Selected_Edge_Color=colour_swatch_4,
    Component_Warning_Selected_Text_Color=colour_swatch_3,
    Component_Error_Deselected_Fill_Color=colour_swatch,
    Component_Error_Deselected_Edge_Color=colour_swatch_4,
    Component_Error_Deselected_Text_Color=colour_swatch_3,
    Component_Error_Selected_Fill_Color=RGB(255, 255, 255),
    Component_Error_Selected_Edge_Color=colour_swatch_4,
    Component_Error_Selected_Text_Color=colour_swatch_3,
    Component_Label_Deselected_Fill_Color=RGB(50, 50, 50),
    Component_Label_Deselected_Edge_Color=colour_swatch_4,
    Component_Label_Deselected_Text_Color=colour_swatch_3,
    Component_Label_Selected_Fill_Color=RGB(25, 60, 25),
    Component_Label_Selected_Edge_Color=colour_swatch_4,
    Component_Label_Selected_Text_Color=colour_swatch_3,
    Galapagos_Deselected_Fill_Color=RGB(252, 252, 252),
    Galapagos_Deselected_Edge_Color=colour_swatch_4,
    Galapagos_Selected_Fill_Color=RGB(255, 255, 255),
    Galapagos_Selected_Edge_Color=colour_swatch_4,
    Wire_Normal_Color=colour_swatch_5,
    Wire_Empty_Color=colour_swatch_5,
    Wire_Selected_Start_Color=colour_swatch_6,
    Wire_Selected_End_Color=colour_swatch_6,
    Panel_Default_Color=RGB(255, 255, 255),
    Group_Default_Color=RGB(255, 255, 255),
    Canvas_Background_Color=RGB(255, 255, 255),
    Canvas_Gridline_Color=RGB(240, 240, 240),
    Canvas_Gridline_Width=2,
    Canvas_Gridline_Height=2,
    Canvas_Edge_Color=RGB(207, 207, 207),
    Canvas_Shadow_Color=RGBA(237, 237, 237, 0),
    Canvas_Shadow_Size=2,
    MonochromaticOnOff=False,
    Monochromatic_Color=RGB(255, 255, 255))
circle = Circle(Plane=PlaneXY(0, 0, 0.5), Radius=0.5)
power = Power(A="2", B=digit_scroller_20)
infoglasses = InfoGlasses(
    Run=True,
    Language=0,
    BackGroundColor=RGB(255, 255, 255),
    BoundaryColor=RGB(115, 115, 115),
    English=True,
    FullName_Category=True,
    Merge_Box=True,
    TextColor=RGB(59, 59, 59),
    assemBoxWidth=1000,
    assemFontSize=8,
    assemSet=False,
    assemboxHeight=0,
    autoHeight=False,
    avoidPro=True,
    cateSet=False,
    highLightRadius=2,
    nameBoxDistance=1,
    nameBoxFontSize=8,
    showName=False,
    showNickName=False,
    showPlugin=False)  # disabled
one_over_x = OneOverX(Value=power)
create_material = CreateMaterial(Diffuse=RGB(207, 207, 207), Specular=RGB(0, 255, 255), Emission=RGB(0, 0, 0), Transparency=0.5, Shine=100)  # disabled
create_material_2 = CreateMaterial(Diffuse=RGB(232, 232, 232), Specular=RGB(0, 255, 255), Emission=RGB(0, 0, 0), Transparency=0.5, Shine=100)  # disabled
O_2 = DigitScroller(Scroller_Digits=12, Scroller_Prefix=" O", Scroller_Radix=11, Scroller_Value=40)
number = Number(expr("X/8", O_2))
range = Range(Domain=Domain(0, 1), Steps=O_2)
polygon = Polygon(Plane=PlaneXY(0, 0, 0.3535533906), Radius=expression, Segments=O_2, FilletRadius=0, Polygon=True)  # -> Polygon, Length
geometry = Geometry(polygon.Polygon)
scale = Scale(Geometry=geometry, Center=Point(0, 0, 0), Factor=power)  # -> Geometry, Transform
geometry_2 = Geometry(scale.Geometry)
rotate = Rotate(Geometry=geometry_2, Angle=expr("-360/X/2", degrees(O_2)), Plane=PlaneXY(0, 0, 0))  # -> Geometry, Transform
rotate_2 = Rotate(Geometry=rotate.Geometry, Angle=1.570796327, Plane=PlaneXY(0, 0, 0))  # -> Geometry, Transform
V = DigitScroller(Scroller_Digits=12, Scroller_Prefix=" V", Scroller_Radix=11, Scroller_Value=16)
derivatives = Derivatives()  # -> Point, FirstDerivative, SecondDerivative, ThirdDerivative, FourthDerivative, FifthDerivative, SixthDerivative; disabled
line_sdl_2 = LineSDL(Direction=derivatives.ThirdDerivative, Length=expr("-X", 1))  # disabled
evaluate_length = EvaluateLength(Curve=line_sdl_2, Length=1, Normalized=True)  # -> Point, Tangent, Parameter; disabled
interpolate = Interpolate(Vertices=evaluate_length.Point, Degree=3, Periodic=False, KnotStyle=2)  # -> Curve, Length, Domain; disabled
quick_graph = QuickGraph(derivatives.SixthDerivative, SortOrder=0)  # disabled
quick_graph_2 = QuickGraph(derivatives.FifthDerivative, SortOrder=0)  # disabled
quick_graph_3 = QuickGraph(derivatives.FourthDerivative, SortOrder=0)  # disabled
quick_graph_4 = QuickGraph(derivatives.ThirdDerivative, SortOrder=0)  # disabled
quick_graph_5 = QuickGraph(derivatives.SecondDerivative, SortOrder=0)  # disabled
quick_graph_6 = QuickGraph(derivatives.FirstDerivative, SortOrder=0)  # disabled
quick_graph_7 = QuickGraph(derivatives.Point, SortOrder=0)  # disabled
custom_preview = CustomPreview(Geometry=interpolate.Curve, Material=create_material)  # disabled
custom_preview_2 = CustomPreview(Geometry=line_sdl_2, Material=create_material_2)  # disabled
quad_sphere = QuadSphere(Base=PlaneXY(0, 0, 0), Radius=0.5)
deconstruct_brep = DeconstructBrep(Brep=quad_sphere)  # -> Faces, Edges, Vertices
list_item = ListItem(List=deconstruct_brep.Faces, Index=0, Wrap=True)
brep_edges = BrepEdges(Brep=list_item)  # -> Naked, Interior, NonManifold
list_item_2 = ListItem(List=brep_edges.Naked, Index=2, Wrap=True)
point = Point(Point(0, 0, 0.3535533906))
number_2 = Number(point)
construct_domain = ConstructDomain(DomainStart=expr("-X", number_2), DomainEnd=number_2)
plane_surface = PlaneSurface(Plane=point, XSize=construct_domain, YSize=construct_domain)
center_box = CenterBox(Base=PlaneXY(0, 0, 0), X=number_2, Y=number_2, Z=number_2)
simple_mesh = SimpleMesh(Brep=plane_surface)
weaverbird_s_sierpinski_carpet = WeaverbirdsSierpinskiCarpet(MeshPolylines=simple_mesh, Distance=division, InsetType=0)
fast_loop_start = FastLoopStart(Iterations=subtraction, Data=weaverbird_s_sierpinski_carpet)  # -> port, Counter, Data
scale_2 = Scale(Geometry=fast_loop_start.Data, Center=point, Factor=expression_2)  # -> Geometry, Transform
fast_loop_end = FastLoopEnd(port=fast_loop_start.port, Exit=False, Data=scale_2.Geometry, RecordData=True, TimeOutVal=0)
point_2 = Point(point)
merge = Merge(Data1=ColourSwatch(SwatchColor=RGB(255, 255, 255)), Data2=ColourSwatch(SwatchColor=RGB(0, 0, 0)))
colors = Colors([RGB(255, 255, 255), RGBA(0, 0, 0, 0)])
parameters = Parameters([0, 1])
digit_scroller_21 = DigitScroller(Scroller_Digits=12, Scroller_Prefix="Digit Scroller", Scroller_Radix=4, Scroller_Value=9)
curve = Curve()
curve_2 = Curve(graft(curve))
number_3 = Number()
number_4 = Number(expr("X*2+1", number_3))
diference_curwature_linear_graph = DIFERENCECURWATURELINEARGRAPH(
    y_component=digit_scroller,
    B=digit_scroller_2,
    y_component_2=digit_scroller_3,
    B_2=digit_scroller_4,
    y_component_3=digit_scroller_5,
    B_3=digit_scroller_6,
    y_component_4=digit_scroller_7,
    B_4=digit_scroller_8,
    y_component_5=digit_scroller_9,
    B_5=digit_scroller_10,
    y_component_6=digit_scroller_11,
    B_6=digit_scroller_12,
    y_component_7=digit_scroller_13,
    B_7=digit_scroller_14,
    y_component_8=digit_scroller_15,
    B_8=digit_scroller_16,
    y_component_9=digit_scroller_17,
    B_9=digit_scroller_18,
    count=number_4,
    curve=curve_2)  # disabled
pattern = Pattern([1, 0, 0, 1])
divide_curve = DivideCurve(Curve=rotate_2.Geometry, Count=O_2, Kinks=False)  # -> Points, Tangents, Parameters
line = Line(StartPoint=point, EndPoint=divide_curve.Points)
flip_curve = FlipCurve(Curve=line)  # -> Curve, Flag
number_5 = Number(expr("X*2+1", number_3))

digit_scroller_22 = DigitScroller(Scroller_Digits=12, Scroller_Prefix=" ", Scroller_Radix=3, Scroller_Value=0.019)
digit_scroller_23 = DigitScroller(Scroller_Digits=12, Scroller_Prefix=" ", Scroller_Radix=2, Scroller_Value=0.02)
digit_scroller_24 = DigitScroller(Scroller_Digits=12, Scroller_Prefix=" ", Scroller_Radix=2, Scroller_Value=0.02)
digit_scroller_25 = DigitScroller(Scroller_Digits=12, Scroller_Prefix=" ", Scroller_Radix=1, Scroller_Value=0.021)
digit_scroller_26 = DigitScroller(Scroller_Digits=12, Scroller_Prefix=" ", Scroller_Radix=1, Scroller_Value=0.022)
digit_scroller_27 = DigitScroller(Scroller_Digits=12, Scroller_Prefix=" ", Scroller_Radix=1, Scroller_Value=0.022)
digit_scroller_28 = DigitScroller(Scroller_Digits=12, Scroller_Prefix=" ", Scroller_Radix=1, Scroller_Value=0.022)
digit_scroller_29 = DigitScroller(Scroller_Digits=12, Scroller_Prefix=" ", Scroller_Radix=1, Scroller_Value=0.03)
curve_3 = Curve(graft(curve))
diference_curwature_shaped_graph = DIFERENCECURWATURESHAPEDGRAPH(
    B=digit_scroller_22,
    B_2=digit_scroller_23,
    B_3=digit_scroller_24,
    B_4=digit_scroller_25,
    B_5=digit_scroller_26,
    B_6=digit_scroller_27,
    B_7=digit_scroller_28,
    B_8=digit_scroller_29,
    count=number_5,
    curve=curve_3)

subtraction_2 = Subtraction(A=V, B=2)
distance = Distance(PointA=Point(0, 0, 0), PointB=divide_curve.Points)
list_item_3 = ListItem(List=distance, Index=0, Wrap=True)
arc = Arc(Plane=Plane(origin=(0, 0, 0), x=(0, 0, 1), y=(0, 1, 0)), Radius=list_item_3, Angle=Domain(0, 0.7853981634))  # -> Arc, Length
list_item_4 = ListItem(List=line, Index=0, Wrap=True)
evaluate_length_2 = EvaluateLength(Curve=list_item_4, Length=1, Normalized=True)  # -> Point, Tangent, Parameter
list_item_5 = ListItem(List=line, Index=1, Wrap=True)
circle_tantantan = CircleTanTanTan(CurveA=rotate_2.Geometry, CurveB=list_item_4, CurveC=list_item_5, Point=evaluate_length_2.Point)
rotate_3 = Rotate(Geometry=arc.Arc, Angle=expr("-360/X/2", degrees(O_2)), Plane=PlaneXY(0, 0, 0))  # -> Geometry, Transform
deconstruct_arc = DeconstructArc(Arc=circle_tantantan)  # -> BasePlane, Radius, Angle
deconstruct = Deconstruct(Point=deconstruct_arc.BasePlane)  # -> XComponent, YComponent, ZComponent
fast_loop_start_2 = FastLoopStart(Iterations=subtraction_2, Data=circle_tantantan)  # -> port, Counter, Data
digit_scroller_30 = DigitScroller(Scroller_Digits=12, Scroller_Prefix="Digit Scroller", Scroller_Radix=2, Scroller_Value=0.6)
cluster = Cluster(A=fast_loop_start_2.Data, crv_2=list_item_4, crv=list_item_5)
digit_scroller_31 = DigitScroller(Scroller_Digits=12, Scroller_Prefix="Digit Scroller", Scroller_Radix=3, Scroller_Value=16)
merge_2 = Merge(Data1=fast_loop_start_2.Data, Data2=cluster)
polar_array = PolarArray(Geometry=rotate_3.Geometry, Plane=PlaneXY(0, 0, 0), Count=O_2, Angle=6.283185307)  # -> Geometry, Transform
list_item_6 = ListItem(List=polar_array.Geometry, Index=0, Wrap=True)
list_item_7 = ListItem(List=polar_array.Geometry, Index=1, Wrap=True)
ggremoveduplicates = GgRemoveDuplicates(Curves=merge_2, Tol=2.328306437e-10)
rotate_4 = Rotate(Angle=1.570796327, Plane=PlaneXY(0, 0, 0))  # -> Geometry, Transform
digit_scroller_32 = DigitScroller(Scroller_Digits=12, Scroller_Prefix=" ", Scroller_Radix=2, Scroller_Value=4)
fast_loop_end_2 = FastLoopEnd(port=fast_loop_start_2.port, Exit=False, Data=ggremoveduplicates, RecordData=False, TimeOutVal=0)
digit_scroller_33 = DigitScroller(Scroller_Digits=12, Scroller_Prefix="Digit Scroller", Scroller_Radix=11, Scroller_Value=10)
digit_scroller_34 = DigitScroller(Scroller_Digits=12, Scroller_Prefix="Digit Scroller", Scroller_Radix=1, Scroller_Value=2)
construct_domain_2 = ConstructDomain(DomainStart=digit_scroller_30, DomainEnd=0)
deconstruct_arc_2 = DeconstructArc(Arc=fast_loop_end_2)  # -> BasePlane, Radius, Angle
evaluate_length_3 = EvaluateLength(Curve=circle_tantantan, Length=0, Normalized=True)  # -> Point, Tangent, Parameter
quick_graph_8 = QuickGraph(deconstruct_arc_2.Radius, SortOrder=0)
evaluate_length_4 = EvaluateLength(Curve=fast_loop_end_2, Length=0.5, Normalized=True)  # -> Point, Tangent, Parameter
deconstruct_2 = Deconstruct(Point=evaluate_length_4.Point)  # -> XComponent, YComponent, ZComponent
construct_point_2 = ConstructPoint(XCoordinate=0, YCoordinate=0, ZCoordinate=deconstruct_2.ZComponent)
list_item_8 = ListItem(List=evaluate_length_4.Point, Index=-1, Wrap=True)
division_2 = Division(A=O_2, B=digit_scroller_34)
number_6 = Number(360)
expression_3 = Expression(O=deconstruct_arc_2.Radius, Expression="LOG(O)")
power_2 = Power(A="2", B=digit_scroller_32)
one_over_x_2 = OneOverX(Value=power_2)
division_3 = Division(A=number_6, B=digit_scroller_34)
polar_array_2 = PolarArray(Geometry=fast_loop_end_2, Plane=PlaneXY(0, 0, 0), Count=division_2, Angle=degrees(division_3))  # -> Geometry, Transform
range_2 = Range(Domain=construct_domain_2, Steps=digit_scroller_31)
expression_4 = Expression(O=range_2, Expression="(EXP(EXP(EXP(O))))")
bounds = Bounds(Numbers=expression_4)
bounds_2 = Bounds(Numbers=expression_4)
division_4 = Division(A=O_2, B="8")
expression_5 = Expression(O=expression_3, Expression="EXP(O)")
merge_3 = Merge(Data1=evaluate_length_3.Point, Data2=evaluate_length_4.Point)  # -> flatten(Result)
distance_2 = Distance(PointA=point, PointB=merge_3)
list_item_9 = ListItem(List=distance_2, Index=0, Wrap=True)
bounds_3 = Bounds(Numbers=distance_2)
deconstruct_domain = DeconstructDomain(Domain=bounds_3)  # -> Start, End
division_5 = Division(A=distance_2, B=deconstruct_domain.End)
number_7 = Number(distance_2)
multiplication_2 = Multiplication(A="2*SQRT(2)", B=number_7)
scale_3 = Scale(Geometry=list_item_2, Center=point_2, Factor=multiplication_2)  # -> Geometry, Transform
multiplication_3 = Multiplication(A="2*SQRT(2)", B=number_7)
one_over_x_3 = OneOverX(Value=multiplication_3)
polygon_2 = Polygon(Plane=construct_point_2, Radius=distance_2, Segments=O_2, FilletRadius=0, Polygon=True)  # -> Polygon, Length
merge_4 = Merge(Data1=geometry, Data2=polygon_2.Polygon)
curve_domain = CurveDomain(Curve=merge_4)  # -> Curve, Domain
deconstruct_domain_2 = DeconstructDomain(Domain=curve_domain.Domain)  # -> Start, End
construct_domain_3 = ConstructDomain(DomainStart=expr("X*1/8", deconstruct_domain_2.End), DomainEnd=expr("X*2/8", deconstruct_domain_2.End))
sub_curve = SubCurve(BaseCurve=curve_domain.Curve, Domain=construct_domain_3)  # -> flatten(Curve)
list_item_10 = ListItem(List=sub_curve, Index=-1, Wrap=True)
tween_two_curves_on_surface = TweenTwoCurvesOnSurface(CurveA=list_item_2, CurveB=list_item_10, Surface=list_item, Factor=multiplication_3, Refit=0, PointSample=0)  # disabled
list_item_11 = ListItem(List=sub_curve, Index=0, Wrap=True)
list_item_12 = ListItem(List=sub_curve, Index=-1, Wrap=True)
explode = Explode(Curve=list_item_11, Recursive=True)  # -> Segments, Vertices
explode_2 = Explode(Curve=list_item_12, Recursive=True)  # -> Segments, Vertices
panel = Panel(distance_2)
line_2 = Line(StartPoint=explode.Vertices, EndPoint=explode_2.Vertices)
extend_curve = ExtendCurve(Curve=line_2, Type=0, Start=65536, End=0)
curve_curve = CurveCurve(CurveA=line_sdl, CurveB=extend_curve)  # -> flatten(Points), ParamsA, ParamsB
polyline = PolyLine(Vertices=curve_curve.Points, Closed=False)
scale_4 = Scale(Geometry=polyline, Center=point, Factor=division_5)  # -> Geometry, Transform
list_item_13 = ListItem(List=scale_4.Geometry, Index=0, Wrap=True)
list_item_14 = ListItem(List=scale_4.Geometry, Index=-1, Wrap=True)
explode_3 = Explode(Curve=list_item_13, Recursive=True)  # -> Segments, Vertices
explode_4 = Explode(Curve=list_item_14, Recursive=True)  # -> Segments, Vertices
line_3 = Line(StartPoint=explode_3.Vertices, EndPoint=explode_4.Vertices)
quick_graph_9 = QuickGraph(distance_2, SortOrder=0)

merge_5 = Merge(Data1=line_3, Data2=scale_4.Geometry)  # -> flatten(Result)
merge_6 = Merge(Data1=line_2, Data2=sub_curve)  # -> flatten(Result)
digit_scroller_35 = DigitScroller(Scroller_Digits=12, Scroller_Prefix=" ", Scroller_Radix=11, Scroller_Value=1)
stream_filter = StreamFilter(Gate=digit_scroller_35, Stream0=merge_6, Stream1=merge_5)

list_item_15 = ListItem(List=distance_2, Index=0, Wrap=True)
bounds_4 = Bounds(Numbers=distance_2)
division_6 = Division(A=distance_2, B=list_item_15)
scale_5 = Scale(Geometry=polygon.Polygon, Center=point, Factor=division_6)  # -> Geometry, Transform
panel_2 = Panel(scale_5.Geometry)
scale_6 = Scale(Geometry=stream_filter, Center=Point(0, 0, 0), Factor=power_2)  # -> Geometry, Transform
divide_curves_on_intersects = DivideCurvesOnIntersects(Curves=flatten(scale_6.Geometry), Tolerance=1.525878906e-05)
deconstruct_domain_3 = DeconstructDomain(Domain=bounds_4)  # -> Start, End
ggnetworkpolygons = GgNetworkPolygons(Curves=flatten(divide_curves_on_intersects), PerimOrVoid=4)
quick_graph_10 = QuickGraph(expression_3, SortOrder=0)
simple_mesh_2 = SimpleMesh(Brep=ggnetworkpolygons)
deconstruct_domain_4 = DeconstructDomain(Domain=bounds)  # -> expr("ABS(X)", Start), expr("ABS(X)", End)
remap_numbers = RemapNumbers(Value=expression_4, Source=bounds_2, Target=Domain(0, 0.5))  # -> Mapped, Clipped
multiplication_4 = Multiplication(A=division_4, B=2)
rotate_5 = Rotate(Geometry=polar_array_2.Geometry, Angle=expr("360/X/2", degrees(O_2)), Plane=PlaneXY(0, 0, 0))  # -> Geometry, Transform
divide_curve_2 = DivideCurve(Curve=line_sdl, Count=expr("X/8", O_2), Kinks=False)  # -> Points, Tangents, Parameters
mesh_join = MeshJoin(Meshes=simple_mesh_2)
quick_graph_11 = QuickGraph(expression_5, SortOrder=0)
maximum = Maximum(A=deconstruct_domain_4.Start, B=deconstruct_domain_4.End)
mesh_weldvertices = MeshWeldVertices(Mesh=mesh_join, Tolerance=2.328306437e-10)  # -> RuntimeMessage, Mesh
scale_7 = Scale(Geometry=mesh_weldvertices.Mesh, Center=Point(0, 0, 0), Factor=one_over_x_2)  # -> Geometry, Transform
mesh_edges = MeshEdges(Mesh=scale_7.Geometry)  # -> NakedEdges, InteriorEdges, NonManifoldEdges
naked_vertices = NakedVertices(Mesh=scale_7.Geometry)  # -> Vertices, Status
point_3 = Point(naked_vertices.Vertices)
list_item_16 = ListItem(List=point_3, Index=7, Wrap=True)
line_sdl_3 = LineSDL(Start=list_item_16, Direction=Vector(1, 0, 0), Length=1)
circle_2 = Circle(Plane=PlaneXY(0, 0, 0), Radius=expr("ABS(X)", distance_2))  # disabled
quick_graph_12 = QuickGraph(remap_numbers.Mapped, SortOrder=0)
expression_6 = Expression(O=multiplication_4, Expression="1-2/O")
division_7 = Division(A=".5", B=maximum)
multiplication_5 = Multiplication(A=expression_4, B=division_7)
polyline_2 = PolyLine(Vertices=divide_curve_2.Points, Closed=False)
digit_scroller_36 = DigitScroller(Scroller_Digits=12, Scroller_Prefix=" ", Scroller_Radix=11, Scroller_Value=8)
quick_graph_13 = QuickGraph(range_2, SortOrder=0)
subtraction_3 = Subtraction(A=digit_scroller_36, B="1")
fast_loop_start_3 = FastLoopStart(Iterations=subtraction_3, Data=polyline_2)  # -> port, Counter, Data
deconstruct_mesh = DeconstructMesh(Mesh=scale_7.Geometry)  # -> Vertices, Faces, Colours, Normals
scale_8 = Scale(Geometry=fast_loop_start_3.Data, Center=point, Factor=expression_6)  # -> Geometry, Transform
rotate_6 = Rotate(Geometry=rotate_5.Geometry, Angle=-0.7853981634, Plane=PlaneXY(0, 0, 0))  # -> Geometry, Transform
geometry_3 = Geometry(rotate_6.Geometry)
scale_9 = Scale(Geometry=geometry_3, Center=Point(0, 0, 0), Factor=one_over_x)  # -> Geometry, Transform
geometry_4 = Geometry(flatten(scale_9.Geometry))
deconstruct_arc_3 = DeconstructArc(Arc=geometry_4)  # -> BasePlane, Radius, Angle; disabled
distance_3 = Distance(PointA=Point(0, 0, 0), PointB=deconstruct_arc_3.BasePlane)  # disabled
construct_drawing = ConstructDrawing(ShapesGeometry=geometry_4, Width=1024, Height=1024, Color=RGBA(255, 255, 255, 0))  # -> Drawing, Boundary; disabled
multiplication_6 = Multiplication(A=distance_3, B=digit_scroller_21)
stroke = Stroke(ShapeGeometry=geometry_4, Color=RGBA(184, 184, 184, 0), Weight=multiplication_6, Pattern=0, EndCap=0)  # disabled
gradient_radial_fill = GradientRadialFill(ShapeGeometry=stroke, Colors=merge, Parameters=parameters)  # disabled
solid_fill = SolidFill(ShapeGeometry=geometry_4, Color=RGB(0, 244, 124))  # disabled
drawing_viewer = DrawingViewer(DrawingsShapesGeometry=construct_drawing.Drawing, Resolution=96)  # disabled
geometry_5 = Geometry(mesh_edges.NakedEdges)
join_curves = JoinCurves(Curves=geometry_5, Preserve=False)
ggsimplifypolyline = GgSimplifyPolyline(Polyline=join_curves, Tol=2.328306437e-10)
explode_5 = Explode(Curve=ggsimplifypolyline, Recursive=True)  # -> Segments, Vertices
list_item_17 = ListItem(List=explode_5.Segments, Index=[6, 7, 8, 9, 10], Wrap=False)
list_item_18 = ListItem(List=explode_5.Segments, Index=5, Wrap=False)
extend_curve_2 = ExtendCurve(Curve=list_item_18, Type=0, Start=1, End=0)
split_curves = SplitCurves(Curves=flatten([line_sdl_3, extend_curve_2]))  # -> flatten(Curves), Points
list_item_19 = ListItem(List=split_curves.Curves, Index=[0, 3], Wrap=True)
join_curves_2 = JoinCurves(Curves=list_item_17, Preserve=False)
list_item_20 = ListItem(List=explode_5.Segments, Index=11, Wrap=False)
fast_loop_end_3 = FastLoopEnd(port=fast_loop_start_3.port, Exit=False, Data=scale_8.Geometry, RecordData=True, TimeOutVal=0)  # -> reverse(flatten(Data))
merge_7 = Merge(Data1=reverse(fast_loop_end_3), Data2=polyline_2)  # -> flatten(Result)
reverse_list = ReverseList(List=merge_7)
merge_8 = Merge(Data1=join_curves_2, Data2=list_item_20, Data3=list_item_19)  # -> flatten(Result)
join_curves_3 = JoinCurves(Curves=merge_8, Preserve=False)
join_curves_4 = JoinCurves(Curves=geometry_5, Preserve=False)
list_item_21 = ListItem(List=reverse_list, Index=0, Wrap=True)
list_item_22 = ListItem(List=reverse_list, Index=-1, Wrap=True)
explode_6 = Explode(Curve=list_item_21, Recursive=True)  # -> Segments, Vertices
explode_7 = Explode(Curve=list_item_22, Recursive=True)  # -> Segments, Vertices
weaverbird_s_face_polylines = WeaverbirdsFacePolylines()
line_4 = Line(StartPoint=explode_6.Vertices, EndPoint=explode_7.Vertices)

# ==== cluster DIFERENCECURWATURESHAPEDGRAPH
curve = ClusterInput()
B = ClusterInput()
B_2 = ClusterInput()
B_3 = ClusterInput()
B_4 = ClusterInput()
B_5 = ClusterInput()
B_6 = ClusterInput()
B_7 = ClusterInput()
B_8 = ClusterInput()

digit_scroller = DigitScroller(Scroller_Digits=12, Scroller_Prefix=" ", Scroller_Radix=11, Scroller_Value=87)  # disabled
create_material = CreateMaterial(Diffuse=RGB(222, 222, 222), Specular=RGB(0, 255, 255), Emission=RGB(0, 0, 0), Transparency=0.5, Shine=100)
create_material_2 = CreateMaterial(Diffuse=RGB(247, 247, 247), Specular=RGB(0, 255, 255), Emission=RGB(0, 0, 0), Transparency=0.5, Shine=100)
create_material_3 = CreateMaterial(Diffuse=RGB(176, 176, 176), Specular=RGB(0, 255, 255), Emission=RGB(0, 0, 0), Transparency=0.5, Shine=100)
count = ClusterInput()
curve_2 = Curve(graft(curve))
divide_curve = DivideCurve(Curve=curve_2, Count=count, Kinks=False)  # -> Points, Tangents, Parameters
curvature = Curvature(Curve=curve_2, Parameter=divide_curve.Parameters)  # -> Point, Curvature, Curvature_2
deconstruct_arc = DeconstructArc(Arc=curvature.Curvature_2)  # -> BasePlane, Radius, Angle
line = Line(StartPoint=curvature.Point, EndPoint=deconstruct_arc.BasePlane)
control_points = ControlPoints(Curve=curve_2)  # -> Points, Weights, Knots
list_length = ListLength(List=control_points.Points)  # -> expr("X-1", Length)
curve_degree = CurveDegree(Curve=curve_2)
expression = Expression(A=list_length, B=curve_degree, Expression="A-B+1")
length = Length(Curve=curve_2)
one_over_x = OneOverX(Value=deconstruct_arc.Radius)
expression_2 = Expression(O=one_over_x, Expression="FORMAT(\"{0:R}\",O)")  # disabled
panel = Panel(expression_2)
quick_graph = QuickGraph(one_over_x, SortOrder=0)
bounds = Bounds(Numbers=one_over_x)
remap_numbers = RemapNumbers(Value=one_over_x, Source=bounds, Target=Domain(0, 1))  # -> Mapped, Clipped
curvature_graph = CurvatureGraph(Curve=curve_2, Density=1, Scale=digit_scroller)  # disabled
custom_preview = CustomPreview(Geometry=curve_2, Material=create_material_3)
multiplication = Multiplication(A=length, B=remap_numbers.Mapped)
multiplication_2 = Multiplication(A=multiplication, B=B_8)
line_sdl = LineSDL(Start=curvature.Point, Direction=curvature.Curvature, Length=expr("-X", multiplication_2))
evaluate_length = EvaluateLength(Curve=line_sdl, Length=1, Normalized=True)  # -> Point, Tangent, Parameter
interpolate = Interpolate(Vertices=evaluate_length.Point, Degree=1, Periodic=False, KnotStyle=2)  # -> Curve, Length, Domain
custom_preview_2 = CustomPreview(Geometry=line_sdl, Material=create_material_2)
number = Number(expression)
number_2 = Number(number)
curve_3 = Curve(interpolate.Curve)
custom_preview_3 = CustomPreview(Geometry=curve_3, Material=create_material)

expression_3 = Expression(O=deconstruct_arc.Radius, Expression="FORMAT(\"{0:R}\",O)")  # disabled
panel_2 = Panel(expression_3)

replace_nulls = ReplaceNulls(Items=one_over_x, Replacements=0)  # -> Items, Count
relative_differences = RelativeDifferences(Values=replace_nulls.Items)
list_length_2 = ListLength(List=relative_differences)
series = Series(Start=1, Step=1, Count=expr("X-1", list_length_2))
list_item = ListItem(List=relative_differences, Index=series, Wrap=False)

expression_4 = Expression(O=list_item, Expression="FORMAT(\"{0:R}\",O)")  # disabled
panel_3 = Panel(expression_4)

replace_nulls_2 = ReplaceNulls(Items=list_item, Replacements=0)  # -> Items, Count
relative_differences_2 = RelativeDifferences(Values=replace_nulls_2.Items)
list_length_3 = ListLength(List=relative_differences_2)
series_2 = Series(Start=1, Step=1, Count=expr("X-1", list_length_3))
list_item_2 = ListItem(List=relative_differences_2, Index=series_2, Wrap=False)

expression_5 = Expression(O=list_item_2, Expression="FORMAT(\"{0:R}\",O)")  # disabled
panel_4 = Panel(expression_5)

replace_nulls_3 = ReplaceNulls(Items=list_item_2, Replacements=0)  # -> Items, Count
relative_differences_3 = RelativeDifferences(Values=replace_nulls_3.Items)
list_length_4 = ListLength(List=relative_differences_3)
series_3 = Series(Start=1, Step=1, Count=expr("X-1", list_length_4))
list_item_3 = ListItem(List=relative_differences_3, Index=series_3, Wrap=False)

expression_6 = Expression(O=list_item_3, Expression="FORMAT(\"{0:R}\",O)")  # disabled
panel_5 = Panel(expression_6)

replace_nulls_4 = ReplaceNulls(Items=list_item_3, Replacements=0)  # -> Items, Count
relative_differences_4 = RelativeDifferences(Values=replace_nulls_4.Items)
list_length_5 = ListLength(List=relative_differences_4)
series_4 = Series(Start=1, Step=1, Count=expr("X-1", list_length_5))
list_item_4 = ListItem(List=relative_differences_4, Index=series_4, Wrap=False)

expression_7 = Expression(O=list_item_4, Expression="FORMAT(\"{0:R}\",O)")  # disabled
panel_6 = Panel(expression_7)

replace_nulls_5 = ReplaceNulls(Items=list_item_4, Replacements=0)  # -> Items, Count
relative_differences_5 = RelativeDifferences(Values=replace_nulls_5.Items)
list_length_6 = ListLength(List=relative_differences_5)
series_5 = Series(Start=1, Step=1, Count=expr("X-1", list_length_6))
list_item_5 = ListItem(List=relative_differences_5, Index=series_5, Wrap=False)

expression_8 = Expression(O=list_item_5, Expression="FORMAT(\"{0:R}\",O)")  # disabled
panel_7 = Panel(expression_8)

replace_nulls_6 = ReplaceNulls(Items=list_item_5, Replacements=0)  # -> Items, Count
relative_differences_6 = RelativeDifferences(Values=replace_nulls_6.Items)
list_length_7 = ListLength(List=relative_differences_6)
series_6 = Series(Start=1, Step=1, Count=expr("X-1", list_length_7))
list_item_6 = ListItem(List=relative_differences_6, Index=series_6, Wrap=False)

expression_9 = Expression(O=list_item_6, Expression="FORMAT(\"{0:R}\",O)")  # disabled
panel_8 = Panel(expression_9)

replace_nulls_7 = ReplaceNulls(Items=list_item_6, Replacements=0)  # -> Items, Count
relative_differences_7 = RelativeDifferences(Values=replace_nulls_7.Items)
list_length_8 = ListLength(List=relative_differences_7)
series_7 = Series(Start=1, Step=1, Count=expr("X-1", list_length_8))
list_item_7 = ListItem(List=relative_differences_7, Index=series_7, Wrap=False)

expression_10 = Expression(O=list_item_7, Expression="FORMAT(\"{0:R}\",O)")  # disabled
panel_9 = Panel(expression_10)

explode = Explode(Curve=curve_3, Recursive=True)  # -> Segments, Vertices
evaluate_length_2 = EvaluateLength(Curve=explode.Segments, Length=0.5, Normalized=True)  # -> Point, Tangent, Parameter
curve_closest_point = CurveClosestPoint(Point=evaluate_length_2.Point, Curve=curve_2)  # -> Point, Parameter, Distance
line_2 = Line(StartPoint=curve_closest_point.Point, EndPoint=evaluate_length_2.Point)

bounds_2 = Bounds(Numbers=list_item_7)
remap_numbers_2 = RemapNumbers(Value=list_item_7, Source=bounds_2, Target=Domain(-1, 1))  # -> Mapped, Clipped
multiplication_3 = Multiplication(A=length, B=remap_numbers_2.Mapped)
multiplication_4 = Multiplication(A=multiplication_3, B=B)

bounds_3 = Bounds(Numbers=list_item_6)
remap_numbers_3 = RemapNumbers(Value=list_item_6, Source=bounds_3, Target=Domain(-1, 1))  # -> Mapped, Clipped
multiplication_5 = Multiplication(A=length, B=remap_numbers_3.Mapped)
multiplication_6 = Multiplication(A=multiplication_5, B=B_2)

bounds_4 = Bounds(Numbers=list_item_5)
remap_numbers_4 = RemapNumbers(Value=list_item_5, Source=bounds_4, Target=Domain(-1, 1))  # -> Mapped, Clipped
multiplication_7 = Multiplication(A=length, B=remap_numbers_4.Mapped)
multiplication_8 = Multiplication(A=multiplication_7, B=B_3)

bounds_5 = Bounds(Numbers=list_item_4)
remap_numbers_5 = RemapNumbers(Value=list_item_4, Source=bounds_5, Target=Domain(-1, 1))  # -> Mapped, Clipped
multiplication_9 = Multiplication(A=length, B=remap_numbers_5.Mapped)
multiplication_10 = Multiplication(A=multiplication_9, B=B_4)

bounds_6 = Bounds(Numbers=list_item_3)
remap_numbers_6 = RemapNumbers(Value=list_item_3, Source=bounds_6, Target=Domain(-1, 1))  # -> Mapped, Clipped
multiplication_11 = Multiplication(A=length, B=remap_numbers_6.Mapped)
multiplication_12 = Multiplication(A=multiplication_11, B=B_5)

bounds_7 = Bounds(Numbers=list_item_2)
remap_numbers_7 = RemapNumbers(Value=list_item_2, Source=bounds_7, Target=Domain(-1, 1))  # -> Mapped, Clipped
multiplication_13 = Multiplication(A=length, B=remap_numbers_7.Mapped)
multiplication_14 = Multiplication(A=multiplication_13, B=B_6)

bounds_8 = Bounds(Numbers=list_item)
remap_numbers_8 = RemapNumbers(Value=list_item, Source=bounds_8, Target=Domain(-1, 1))  # -> Mapped, Clipped
multiplication_15 = Multiplication(A=length, B=remap_numbers_8.Mapped)
multiplication_16 = Multiplication(A=multiplication_15, B=B_7)

create_material_4 = CreateMaterial(Diffuse=RGB(214, 214, 214), Specular=RGB(0, 255, 255), Emission=RGB(0, 0, 0), Transparency=0.5, Shine=100)
create_material_5 = CreateMaterial(Diffuse=RGB(240, 240, 240), Specular=RGB(0, 255, 255), Emission=RGB(0, 0, 0), Transparency=0.5, Shine=100)
quick_graph_2 = QuickGraph(list_item, SortOrder=0)
line_sdl_2 = LineSDL(Start=evaluate_length_2.Point, Direction=line_2, Length=expr("ABS(X)", multiplication_16))
evaluate_length_3 = EvaluateLength(Curve=line_sdl_2, Length=1, Normalized=True)  # -> Point, Tangent, Parameter
interpolate_2 = Interpolate(Vertices=evaluate_length_3.Point, Degree=1, Periodic=False, KnotStyle=2)  # -> Curve, Length, Domain
custom_preview_4 = CustomPreview(Geometry=interpolate_2.Curve, Material=create_material_4)
custom_preview_5 = CustomPreview(Geometry=line_sdl_2, Material=create_material_5)

explode_2 = Explode(Curve=interpolate_2.Curve, Recursive=True)  # -> Segments, Vertices
evaluate_length_4 = EvaluateLength(Curve=explode_2.Segments, Length=0.5, Normalized=True)  # -> Point, Tangent, Parameter
curve_closest_point_2 = CurveClosestPoint(Point=evaluate_length_4.Point, Curve=curve_2)  # -> Point, Parameter, Distance
line_3 = Line(StartPoint=curve_closest_point_2.Point, EndPoint=evaluate_length_4.Point)

create_material_6 = CreateMaterial(Diffuse=RGB(207, 207, 207), Specular=RGB(0, 255, 255), Emission=RGB(0, 0, 0), Transparency=0.5, Shine=100)
create_material_7 = CreateMaterial(Diffuse=RGB(232, 232, 232), Specular=RGB(0, 255, 255), Emission=RGB(0, 0, 0), Transparency=0.5, Shine=100)
quick_graph_3 = QuickGraph(list_item_2, SortOrder=0)
line_sdl_3 = LineSDL(Start=evaluate_length_4.Point, Direction=line_3, Length=expr("ABS(X)", multiplication_14))
evaluate_length_5 = EvaluateLength(Curve=line_sdl_3, Length=1, Normalized=True)  # -> Point, Tangent, Parameter
interpolate_3 = Interpolate(Vertices=evaluate_length_5.Point, Degree=1, Periodic=False, KnotStyle=2)  # -> Curve, Length, Domain
custom_preview_6 = CustomPreview(Geometry=interpolate_3.Curve, Material=create_material_6)
custom_preview_7 = CustomPreview(Geometry=line_sdl_3, Material=create_material_7)

explode_3 = Explode(Curve=interpolate_3.Curve, Recursive=True)  # -> Segments, Vertices
evaluate_length_6 = EvaluateLength(Curve=explode_3.Segments, Length=0.5, Normalized=True)  # -> Point, Tangent, Parameter
curve_closest_point_3 = CurveClosestPoint(Point=evaluate_length_6.Point, Curve=curve_2)  # -> Point, Parameter, Distance
line_4 = Line(StartPoint=curve_closest_point_3.Point, EndPoint=evaluate_length_6.Point)

create_material_8 = CreateMaterial(Diffuse=RGB(199, 199, 199), Specular=RGB(0, 255, 255), Emission=RGB(0, 0, 0), Transparency=0.5, Shine=100)
create_material_9 = CreateMaterial(Diffuse=RGB(224, 224, 224), Specular=RGB(0, 255, 255), Emission=RGB(0, 0, 0), Transparency=0.5, Shine=100)
quick_graph_4 = QuickGraph(list_item_3, SortOrder=0)
line_sdl_4 = LineSDL(Start=evaluate_length_6.Point, Direction=line_4, Length=expr("ABS(X)", multiplication_12))
evaluate_length_7 = EvaluateLength(Curve=line_sdl_4, Length=1, Normalized=True)  # -> Point, Tangent, Parameter
interpolate_4 = Interpolate(Vertices=evaluate_length_7.Point, Degree=1, Periodic=False, KnotStyle=2)  # -> Curve, Length, Domain
custom_preview_8 = CustomPreview(Geometry=interpolate_4.Curve, Material=create_material_8)
custom_preview_9 = CustomPreview(Geometry=line_sdl_4, Material=create_material_9)

explode_4 = Explode(Curve=interpolate_4.Curve, Recursive=True)  # -> Segments, Vertices
evaluate_length_8 = EvaluateLength(Curve=explode_4.Segments, Length=0.5, Normalized=True)  # -> Point, Tangent, Parameter
curve_closest_point_4 = CurveClosestPoint(Point=evaluate_length_8.Point, Curve=curve_2)  # -> Point, Parameter, Distance
line_5 = Line(StartPoint=curve_closest_point_4.Point, EndPoint=evaluate_length_8.Point)

create_material_10 = CreateMaterial(Diffuse=RGB(191, 191, 191), Specular=RGB(0, 255, 255), Emission=RGB(0, 0, 0), Transparency=0.5, Shine=100)
create_material_11 = CreateMaterial(Diffuse=RGB(217, 217, 217), Specular=RGB(0, 255, 255), Emission=RGB(0, 0, 0), Transparency=0.5, Shine=100)
quick_graph_5 = QuickGraph(list_item_4, SortOrder=0)
line_sdl_5 = LineSDL(Start=evaluate_length_8.Point, Direction=line_5, Length=expr("ABS(X)", multiplication_10))
evaluate_length_9 = EvaluateLength(Curve=line_sdl_5, Length=1, Normalized=True)  # -> Point, Tangent, Parameter
interpolate_5 = Interpolate(Vertices=evaluate_length_9.Point, Degree=1, Periodic=False, KnotStyle=2)  # -> Curve, Length, Domain
custom_preview_10 = CustomPreview(Geometry=interpolate_5.Curve, Material=create_material_10)
custom_preview_11 = CustomPreview(Geometry=line_sdl_5, Material=create_material_11)

explode_5 = Explode(Curve=interpolate_5.Curve, Recursive=True)  # -> Segments, Vertices
evaluate_length_10 = EvaluateLength(Curve=explode_5.Segments, Length=0.5, Normalized=True)  # -> Point, Tangent, Parameter
curve_closest_point_5 = CurveClosestPoint(Point=evaluate_length_10.Point, Curve=curve_2)  # -> Point, Parameter, Distance
line_6 = Line(StartPoint=curve_closest_point_5.Point, EndPoint=evaluate_length_10.Point)

create_material_12 = CreateMaterial(Diffuse=RGB(184, 184, 184), Specular=RGB(0, 255, 255), Emission=RGB(0, 0, 0), Transparency=0.5, Shine=100)
create_material_13 = CreateMaterial(Diffuse=RGB(209, 209, 209), Specular=RGB(0, 255, 255), Emission=RGB(0, 0, 0), Transparency=0.5, Shine=100)
quick_graph_6 = QuickGraph(list_item_5, SortOrder=0)
line_sdl_6 = LineSDL(Start=evaluate_length_10.Point, Direction=line_6, Length=expr("ABS(X)", multiplication_8))
evaluate_length_11 = EvaluateLength(Curve=line_sdl_6, Length=1, Normalized=True)  # -> Point, Tangent, Parameter
interpolate_6 = Interpolate(Vertices=evaluate_length_11.Point, Degree=1, Periodic=False, KnotStyle=2)  # -> Curve, Length, Domain
custom_preview_12 = CustomPreview(Geometry=interpolate_6.Curve, Material=create_material_12)
custom_preview_13 = CustomPreview(Geometry=line_sdl_6, Material=create_material_13)

explode_6 = Explode(Curve=interpolate_6.Curve, Recursive=True)  # -> Segments, Vertices
evaluate_length_12 = EvaluateLength(Curve=explode_6.Segments, Length=0.5, Normalized=True)  # -> Point, Tangent, Parameter
curve_closest_point_6 = CurveClosestPoint(Point=evaluate_length_12.Point, Curve=curve_2)  # -> Point, Parameter, Distance
line_7 = Line(StartPoint=curve_closest_point_6.Point, EndPoint=evaluate_length_12.Point)

create_material_14 = CreateMaterial(Diffuse=RGB(176, 176, 176), Specular=RGB(0, 255, 255), Emission=RGB(0, 0, 0), Transparency=0.5, Shine=100)
create_material_15 = CreateMaterial(Diffuse=RGB(201, 201, 201), Specular=RGB(0, 255, 255), Emission=RGB(0, 0, 0), Transparency=0.5, Shine=100)
quick_graph_7 = QuickGraph(list_item_6, SortOrder=0)
line_sdl_7 = LineSDL(Start=evaluate_length_12.Point, Direction=line_7, Length=expr("ABS(X)", multiplication_6))
evaluate_length_13 = EvaluateLength(Curve=line_sdl_7, Length=1, Normalized=True)  # -> Point, Tangent, Parameter
interpolate_7 = Interpolate(Vertices=evaluate_length_13.Point, Degree=1, Periodic=False, KnotStyle=2)  # -> Curve, Length, Domain
custom_preview_14 = CustomPreview(Geometry=interpolate_7.Curve, Material=create_material_14)
custom_preview_15 = CustomPreview(Geometry=line_sdl_7, Material=create_material_15)

explode_7 = Explode(Curve=interpolate_7.Curve, Recursive=True)  # -> Segments, Vertices
evaluate_length_14 = EvaluateLength(Curve=explode_7.Segments, Length=0.5, Normalized=True)  # -> Point, Tangent, Parameter
curve_closest_point_7 = CurveClosestPoint(Point=evaluate_length_14.Point, Curve=curve_2)  # -> Point, Parameter, Distance
line_8 = Line(StartPoint=curve_closest_point_7.Point, EndPoint=evaluate_length_14.Point)

create_material_16 = CreateMaterial(Diffuse=RGB(176, 176, 176), Specular=RGB(0, 255, 255), Emission=RGB(0, 0, 0), Transparency=0.5, Shine=100)
create_material_17 = CreateMaterial(Diffuse=RGB(201, 201, 201), Specular=RGB(0, 255, 255), Emission=RGB(0, 0, 0), Transparency=0.5, Shine=100)
quick_graph_8 = QuickGraph(list_item_7, SortOrder=0)
line_sdl_8 = LineSDL(Start=evaluate_length_14.Point, Direction=line_8, Length=expr("ABS(X)", multiplication_4))
evaluate_length_15 = EvaluateLength(Curve=line_sdl_8, Length=1, Normalized=True)  # -> Point, Tangent, Parameter
interpolate_8 = Interpolate(Vertices=evaluate_length_15.Point, Degree=1, Periodic=False, KnotStyle=2)  # -> Curve, Length, Domain
custom_preview_16 = CustomPreview(Geometry=interpolate_8.Curve, Material=create_material_16)
custom_preview_17 = CustomPreview(Geometry=line_sdl_8, Material=create_material_17)

# ==== cluster DIFERENCECURWATURELINEARGRAPH
y_component = ClusterInput()
y_component_2 = ClusterInput()
y_component_3 = ClusterInput()
y_component_4 = ClusterInput()
y_component_5 = ClusterInput()
y_component_6 = ClusterInput()
y_component_7 = ClusterInput()
y_component_8 = ClusterInput()
y_component_9 = ClusterInput()
B = ClusterInput()
B_2 = ClusterInput()
B_3 = ClusterInput()
B_4 = ClusterInput()
B_5 = ClusterInput()
B_6 = ClusterInput()
B_7 = ClusterInput()
B_8 = ClusterInput()
B_9 = ClusterInput()

line_sdl = LineSDL(Start=Point(-2.121093912, 1.99985794, 0), Direction=Vector(0.0625, 0.0625, 0), Length=1)

line_sdl_2 = LineSDL(Start=Point(0, 0, 0), Direction=Vector(1, 0, 0), Length=1)

create_material = CreateMaterial(Diffuse=RGB(161, 161, 161), Specular=RGB(0, 255, 255), Emission=RGB(0, 0, 0), Transparency=0.5, Shine=100)

create_material_2 = CreateMaterial(Diffuse=RGB(186, 186, 186), Specular=RGB(0, 255, 255), Emission=RGB(0, 0, 0), Transparency=0.5, Shine=100)

create_material_3 = CreateMaterial(Diffuse=RGB(168, 168, 168), Specular=RGB(0, 255, 255), Emission=RGB(0, 0, 0), Transparency=0.5, Shine=100)

create_material_4 = CreateMaterial(Diffuse=RGB(194, 194, 194), Specular=RGB(0, 255, 255), Emission=RGB(0, 0, 0), Transparency=0.5, Shine=100)

create_material_5 = CreateMaterial(Diffuse=RGB(176, 176, 176), Specular=RGB(0, 255, 255), Emission=RGB(0, 0, 0), Transparency=0.5, Shine=100)

create_material_6 = CreateMaterial(Diffuse=RGB(201, 201, 201), Specular=RGB(0, 255, 255), Emission=RGB(0, 0, 0), Transparency=0.5, Shine=100)

create_material_7 = CreateMaterial(Diffuse=RGB(184, 184, 184), Specular=RGB(0, 255, 255), Emission=RGB(0, 0, 0), Transparency=0.5, Shine=100)

create_material_8 = CreateMaterial(Diffuse=RGB(209, 209, 209), Specular=RGB(0, 255, 255), Emission=RGB(0, 0, 0), Transparency=0.5, Shine=100)

create_material_9 = CreateMaterial(Diffuse=RGB(191, 191, 191), Specular=RGB(0, 255, 255), Emission=RGB(0, 0, 0), Transparency=0.5, Shine=100)

create_material_10 = CreateMaterial(Diffuse=RGB(217, 217, 217), Specular=RGB(0, 255, 255), Emission=RGB(0, 0, 0), Transparency=0.5, Shine=100)

create_material_11 = CreateMaterial(Diffuse=RGB(199, 199, 199), Specular=RGB(0, 255, 255), Emission=RGB(0, 0, 0), Transparency=0.5, Shine=100)

create_material_12 = CreateMaterial(Diffuse=RGB(224, 224, 224), Specular=RGB(0, 255, 255), Emission=RGB(0, 0, 0), Transparency=0.5, Shine=100)

create_material_13 = CreateMaterial(Diffuse=RGB(207, 207, 207), Specular=RGB(0, 255, 255), Emission=RGB(0, 0, 0), Transparency=0.5, Shine=100)

create_material_14 = CreateMaterial(Diffuse=RGB(232, 232, 232), Specular=RGB(0, 255, 255), Emission=RGB(0, 0, 0), Transparency=0.5, Shine=100)

create_material_15 = CreateMaterial(Diffuse=RGB(214, 214, 214), Specular=RGB(0, 255, 255), Emission=RGB(0, 0, 0), Transparency=0.5, Shine=100)

create_material_16 = CreateMaterial(Diffuse=RGB(240, 240, 240), Specular=RGB(0, 255, 255), Emission=RGB(0, 0, 0), Transparency=0.5, Shine=100)

create_material_17 = CreateMaterial(Diffuse=RGB(222, 222, 222), Specular=RGB(0, 255, 255), Emission=RGB(0, 0, 0), Transparency=0.5, Shine=100)

create_material_18 = CreateMaterial(Diffuse=RGB(247, 247, 247), Specular=RGB(0, 255, 255), Emission=RGB(0, 0, 0), Transparency=0.5, Shine=100)

count = ClusterInput()
curve = ClusterInput()
curve_2 = Curve(graft(curve))
divide_curve = DivideCurve(Curve=curve_2, Count=count, Kinks=False)  # -> Points, Tangents, Parameters
curvature = Curvature(Curve=curve_2, Parameter=divide_curve.Parameters)  # -> Point, Curvature, Curvature_2
deconstruct_arc = DeconstructArc(Arc=curvature.Curvature_2)  # -> BasePlane, Radius, Angle
expression = Expression(O=deconstruct_arc.Radius, Expression="FORMAT(\"{0:R}\",O)")
panel = Panel(expression)
quick_graph = QuickGraph(deconstruct_arc.Radius, SortOrder=0)
curve_degree = CurveDegree(Curve=curve_2)
one_over_x = OneOverX(Value=deconstruct_arc.Radius)

expression_2 = Expression(O=one_over_x, Expression="FORMAT(\"{0:R}\",O)")
panel_2 = Panel(expression_2)

replace_nulls = ReplaceNulls(Items=one_over_x, Replacements=0)  # -> Items, Count
relative_differences = RelativeDifferences(Values=replace_nulls.Items)

control_points = ControlPoints(Curve=curve_2)  # -> Points, Weights, Knots
list_length = ListLength(List=control_points.Points)  # -> expr("X-1", Length)

expression_3 = Expression(O=relative_differences, Expression="FORMAT(\"{0:R}\",O)")
panel_3 = Panel(expression_3)
quick_graph_2 = QuickGraph(relative_differences, SortOrder=0)
multiplication = Multiplication(A=relative_differences, B=B_8)

quick_graph_3 = QuickGraph(one_over_x, SortOrder=0)
multiplication_2 = Multiplication(A=one_over_x, B=B_9)

replace_nulls_2 = ReplaceNulls(Items=relative_differences, Replacements=0)  # -> Items, Count
relative_differences_2 = RelativeDifferences(Values=replace_nulls_2.Items)
expression_4 = Expression(O=relative_differences_2, Expression="FORMAT(\"{0:R}\",O)")
panel_4 = Panel(expression_4)
quick_graph_4 = QuickGraph(relative_differences_2, SortOrder=0)
multiplication_3 = Multiplication(A=relative_differences_2, B=B_7)

replace_nulls_3 = ReplaceNulls(Items=relative_differences_2, Replacements=0)  # -> Items, Count
relative_differences_3 = RelativeDifferences(Values=replace_nulls_3.Items)
expression_5 = Expression(O=relative_differences_3, Expression="FORMAT(\"{0:R}\",O)")
panel_5 = Panel(expression_5)
quick_graph_5 = QuickGraph(relative_differences_3, SortOrder=0)
multiplication_4 = Multiplication(A=relative_differences_3, B=B_6)

replace_nulls_4 = ReplaceNulls(Items=relative_differences_3, Replacements=0)  # -> Items, Count
relative_differences_4 = RelativeDifferences(Values=replace_nulls_4.Items)
expression_6 = Expression(O=relative_differences_4, Expression="FORMAT(\"{0:R}\",O)")
panel_6 = Panel(expression_6)
quick_graph_6 = QuickGraph(relative_differences_4, SortOrder=0)
multiplication_5 = Multiplication(A=relative_differences_4, B=B_5)

replace_nulls_5 = ReplaceNulls(Items=relative_differences_4, Replacements=0)  # -> Items, Count
relative_differences_5 = RelativeDifferences(Values=replace_nulls_5.Items)
expression_7 = Expression(O=relative_differences_5, Expression="FORMAT(\"{0:R}\",O)")
panel_7 = Panel(expression_7)
quick_graph_7 = QuickGraph(relative_differences_5, SortOrder=0)
multiplication_6 = Multiplication(A=relative_differences_5, B=B_4)

replace_nulls_6 = ReplaceNulls(Items=relative_differences_5, Replacements=0)  # -> Items, Count
relative_differences_6 = RelativeDifferences(Values=replace_nulls_6.Items)

expression_8 = Expression(O=relative_differences_6, Expression="FORMAT(\"{0:R}\",O)")
panel_8 = Panel(expression_8)
quick_graph_8 = QuickGraph(relative_differences_6, SortOrder=0)
multiplication_7 = Multiplication(A=relative_differences_6, B=B_3)

replace_nulls_7 = ReplaceNulls(Items=relative_differences_6, Replacements=0)  # -> Items, Count
relative_differences_7 = RelativeDifferences(Values=replace_nulls_7.Items)
expression_9 = Expression(O=relative_differences_7, Expression="FORMAT(\"{0:R}\",O)")
panel_9 = Panel(expression_9)
quick_graph_9 = QuickGraph(relative_differences_7, SortOrder=0)
multiplication_8 = Multiplication(A=relative_differences_7, B=B_2)

replace_nulls_8 = ReplaceNulls(Items=relative_differences_7, Replacements=0)  # -> Items, Count
relative_differences_8 = RelativeDifferences(Values=replace_nulls_8.Items)
expression_10 = Expression(O=relative_differences_8, Expression="FORMAT(\"{0:R}\",O)")
panel_10 = Panel(expression_10)
quick_graph_10 = QuickGraph(relative_differences_8, SortOrder=0)
multiplication_9 = Multiplication(A=relative_differences_8, B=B)

expression_11 = Expression(A=list_length, B=curve_degree, Expression="A-B+1")
number = Number(expression_11)

divide_curve_2 = DivideCurve(Curve=line_sdl_2, Count=number, Kinks=False)  # -> Points, Tangents, Parameters
line_sdl_3 = LineSDL(Start=divide_curve_2.Points, Direction=Vector(0, 1, 0), Length=multiplication_2)

curve_3 = Curve(line_sdl_3)

list_length_2 = ListLength(List=curve_2)  # -> flatten(Length)
mass_addition = MassAddition(Input=list_length_2)  # -> Result, PartialResults
panel_11 = Panel(mass_addition.Result)
series = Series(Start=1, Step=1, Count=panel_11)  # -> graft(Series)
vector_xyz = VectorXYZ(XComponent=expr("-X", series), YComponent=y_component_9, ZComponent=0)  # -> Vector, Length
move = Move(Geometry=curve_3, Motion=vector_xyz.Vector)  # -> Geometry, Transform
evaluate_length = EvaluateLength(Curve=move.Geometry, Length=1, Normalized=True)  # -> Point, Tangent, Parameter
interpolate = Interpolate(Vertices=evaluate_length.Point, Degree=1, Periodic=False, KnotStyle=2)  # -> Curve, Length, Domain

line_sdl_4 = LineSDL(Start=divide_curve_2.Points, Direction=Vector(0, 1, 0), Length=multiplication_9)
vector_xyz_2 = VectorXYZ(XComponent=expr("-X", series), YComponent=y_component, ZComponent=0)  # -> Vector, Length
move_2 = Move(Geometry=line_sdl_4, Motion=vector_xyz_2.Vector)  # -> Geometry, Transform
evaluate_length_2 = EvaluateLength(Curve=move_2.Geometry, Length=1, Normalized=True)  # -> Point, Tangent, Parameter
interpolate_2 = Interpolate(Vertices=evaluate_length_2.Point, Degree=1, Periodic=False, KnotStyle=2)  # -> Curve, Length, Domain

line_sdl_5 = LineSDL(Start=divide_curve_2.Points, Direction=Vector(0, 1, 0), Length=multiplication_8)
vector_xyz_3 = VectorXYZ(XComponent=expr("-X", series), YComponent=y_component_2, ZComponent=0)  # -> Vector, Length
move_3 = Move(Geometry=line_sdl_5, Motion=vector_xyz_3.Vector)  # -> Geometry, Transform
evaluate_length_3 = EvaluateLength(Curve=move_3.Geometry, Length=1, Normalized=True)  # -> Point, Tangent, Parameter
interpolate_3 = Interpolate(Vertices=evaluate_length_3.Point, Degree=1, Periodic=False, KnotStyle=2)  # -> Curve, Length, Domain

line_sdl_6 = LineSDL(Start=divide_curve_2.Points, Direction=Vector(0, 1, 0), Length=multiplication_7)
vector_xyz_4 = VectorXYZ(XComponent=expr("-X", series), YComponent=y_component_3, ZComponent=0)  # -> Vector, Length
move_4 = Move(Geometry=line_sdl_6, Motion=vector_xyz_4.Vector)  # -> Geometry, Transform
evaluate_length_4 = EvaluateLength(Curve=move_4.Geometry, Length=1, Normalized=True)  # -> Point, Tangent, Parameter
interpolate_4 = Interpolate(Vertices=evaluate_length_4.Point, Degree=1, Periodic=False, KnotStyle=2)  # -> Curve, Length, Domain

line_sdl_7 = LineSDL(Start=divide_curve_2.Points, Direction=Vector(0, 1, 0), Length=multiplication_6)
vector_xyz_5 = VectorXYZ(XComponent=expr("-X", series), YComponent=y_component_4, ZComponent=0)  # -> Vector, Length
move_5 = Move(Geometry=line_sdl_7, Motion=vector_xyz_5.Vector)  # -> Geometry, Transform
evaluate_length_5 = EvaluateLength(Curve=move_5.Geometry, Length=1, Normalized=True)  # -> Point, Tangent, Parameter
interpolate_5 = Interpolate(Vertices=evaluate_length_5.Point, Degree=1, Periodic=False, KnotStyle=2)  # -> Curve, Length, Domain

line_sdl_8 = LineSDL(Start=divide_curve_2.Points, Direction=Vector(0, 1, 0), Length=multiplication_5)
vector_xyz_6 = VectorXYZ(XComponent=expr("-X", series), YComponent=y_component_5, ZComponent=0)  # -> Vector, Length
move_6 = Move(Geometry=line_sdl_8, Motion=vector_xyz_6.Vector)  # -> Geometry, Transform
evaluate_length_6 = EvaluateLength(Curve=move_6.Geometry, Length=1, Normalized=True)  # -> Point, Tangent, Parameter
interpolate_6 = Interpolate(Vertices=evaluate_length_6.Point, Degree=1, Periodic=False, KnotStyle=2)  # -> Curve, Length, Domain

line_sdl_9 = LineSDL(Start=divide_curve_2.Points, Direction=Vector(0, 1, 0), Length=multiplication_4)
vector_xyz_7 = VectorXYZ(XComponent=expr("-X", series), YComponent=y_component_6, ZComponent=0)  # -> Vector, Length
move_7 = Move(Geometry=line_sdl_9, Motion=vector_xyz_7.Vector)  # -> Geometry, Transform
evaluate_length_7 = EvaluateLength(Curve=move_7.Geometry, Length=1, Normalized=True)  # -> Point, Tangent, Parameter
interpolate_7 = Interpolate(Vertices=evaluate_length_7.Point, Degree=1, Periodic=False, KnotStyle=2)  # -> Curve, Length, Domain

line_sdl_10 = LineSDL(Start=divide_curve_2.Points, Direction=Vector(0, 1, 0), Length=multiplication_3)
vector_xyz_8 = VectorXYZ(XComponent=expr("-X", series), YComponent=y_component_7, ZComponent=0)  # -> Vector, Length
move_8 = Move(Geometry=line_sdl_10, Motion=vector_xyz_8.Vector)  # -> Geometry, Transform
evaluate_length_8 = EvaluateLength(Curve=move_8.Geometry, Length=1, Normalized=True)  # -> Point, Tangent, Parameter
interpolate_8 = Interpolate(Vertices=evaluate_length_8.Point, Degree=1, Periodic=False, KnotStyle=2)  # -> Curve, Length, Domain

line_sdl_11 = LineSDL(Start=divide_curve_2.Points, Direction=Vector(0, 1, 0), Length=multiplication)
vector_xyz_9 = VectorXYZ(XComponent=expr("-X", series), YComponent=y_component_8, ZComponent=0)  # -> Vector, Length
move_9 = Move(Geometry=line_sdl_11, Motion=vector_xyz_9.Vector)  # -> Geometry, Transform
evaluate_length_9 = EvaluateLength(Curve=move_9.Geometry, Length=1, Normalized=True)  # -> Point, Tangent, Parameter
interpolate_9 = Interpolate(Vertices=evaluate_length_9.Point, Degree=1, Periodic=False, KnotStyle=2)  # -> Curve, Length, Domain

custom_preview = CustomPreview(Geometry=interpolate_2.Curve, Material=create_material)

custom_preview_2 = CustomPreview(Geometry=move_2.Geometry, Material=create_material_2)

custom_preview_3 = CustomPreview(Geometry=interpolate_3.Curve, Material=create_material_3)

custom_preview_4 = CustomPreview(Geometry=move_3.Geometry, Material=create_material_4)

custom_preview_5 = CustomPreview(Geometry=interpolate_4.Curve, Material=create_material_5)

custom_preview_6 = CustomPreview(Geometry=move_4.Geometry, Material=create_material_6)

custom_preview_7 = CustomPreview(Geometry=interpolate_5.Curve, Material=create_material_7)

custom_preview_8 = CustomPreview(Geometry=move_5.Geometry, Material=create_material_8)

custom_preview_9 = CustomPreview(Geometry=interpolate_6.Curve, Material=create_material_9)

custom_preview_10 = CustomPreview(Geometry=move_6.Geometry, Material=create_material_10)

custom_preview_11 = CustomPreview(Geometry=interpolate_7.Curve, Material=create_material_11)

custom_preview_12 = CustomPreview(Geometry=move_7.Geometry, Material=create_material_12)

custom_preview_13 = CustomPreview(Geometry=interpolate_8.Curve, Material=create_material_13)

custom_preview_14 = CustomPreview(Geometry=move_8.Geometry, Material=create_material_14)

custom_preview_15 = CustomPreview(Geometry=interpolate_9.Curve, Material=create_material_15)

custom_preview_16 = CustomPreview(Geometry=move_9.Geometry, Material=create_material_16)

custom_preview_17 = CustomPreview(Geometry=interpolate.Curve, Material=create_material_17)

custom_preview_18 = CustomPreview(Geometry=move.Geometry, Material=create_material_18)

# ==== cluster Cluster
A = ClusterInput()
crv = ClusterInput()
crv_2 = ClusterInput()
curvepoint = PointOnCurve(A, parameter=0.5)
crv_3 = Curve(crv_2)
crv_4 = Curve(crv)
circlettt = CircleTanTanTan(CurveA=A, CurveB=crv_3, CurveC=crv_4, Point=curvepoint)
C = ClusterOutput(circlettt)
