# Grasshopper definition XHG.⠀⠀⠀⠀ⵙ⠀✤⠀ⵙ⠀ᴥ⠀ⵙ⠀Ⓞ⠀ⵙ⠀ߦ⠀ⵙ⠀ꕤ⠀ⵙ⠀ᗱᗴ⠀ⵙ⠀◯⠀ⵙ⠀ᒍᒐ⠀ⵙ⠀8⠀ⵙ⠀Ⓞ⠀ⵙ⠀◯⠀ⵙ⠀⁂⠀ⵙ⠀△⠀ⵙ⠀ⵈ⠀ⵙ⠀⠀⠀⠀◯⠀⠀⠀⠀ⵙ⠀⠀⠀⠀◯⠀⠀⠀⠀ⵙ⠀ⵈ⠀ⵙ⠀△⠀ⵙ⠀⁂⠀ⵙ⠀◯⠀ⵙ⠀Ⓞ⠀ⵙ⠀8⠀ⵙ⠀ᒍᒐ⠀ⵙ⠀◯⠀ⵙ⠀ᗱᗴ⠀ⵙ⠀ꕤ⠀ⵙ⠀ߦ⠀ⵙ⠀Ⓞ⠀ⵙ⠀ᴥ⠀ⵙ⠀✤⠀ⵙ⠀⠀⠀⠀.GHX (Grasshopper 1.0.7)
# plug-ins: Pancake, Shader Nodes

digit_scroller = DigitScroller(Scroller_Digits=12, Scroller_Prefix="Digit Scroller", Scroller_Radix=11, Scroller_Value=135)
digit_scroller_2 = DigitScroller(Scroller_Digits=12, Scroller_Prefix="Digit Scroller", Scroller_Radix=11, Scroller_Value=130)
digit_scroller_3 = DigitScroller(Scroller_Digits=12, Scroller_Prefix="Digit Scroller", Scroller_Radix=11, Scroller_Value=0)
digit_scroller_4 = DigitScroller(Scroller_Digits=12, Scroller_Prefix="Digit Scroller", Scroller_Radix=11, Scroller_Value=3)
geometry = Geometry([<brep referenced from the Rhino model> x194])
flatten_tree = FlattenTree(Tree=geometry, Path="{0}")
panel = Panel(flatten_tree)
number_slider = Slider(9, range=0..100)
list_item = ListItem(List=flatten_tree, Index=[digit_scroller_4, digit_scroller, digit_scroller_3], Wrap=False)
panel_2 = Panel("-2.53125")
number_slider_2 = Slider(0, range=0..16384)
digit_scroller_5 = DigitScroller(Scroller_Digits=12, Scroller_Prefix="Digit Scroller", Scroller_Radix=11, Scroller_Value=0)

digit_scroller_6 = DigitScroller(Scroller_Digits=12, Scroller_Prefix="Digit Scroller", Scroller_Radix=2, Scroller_Value=-3.474)
digit_scroller_7 = DigitScroller(Scroller_Digits=12, Scroller_Prefix="Digit Scroller", Scroller_Radix=3, Scroller_Value=8)
power = Power(A=9, B=digit_scroller_6)
multiplication = Multiplication(A="1.40625", B=digit_scroller_7)
multiplication_2 = Multiplication(A=power, B="7257.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")
panel_3 = Panel("0")
settings_custom = SettingsCustom(
    StitchSeams=True,
    SimplePlanes=True,
    Refine=False,
    MinCount=digit_scroller_5,
    MaxCount=0,
    AspectRatio=Slider(256, range=0..256),
    MaxDistance=0,
    MaxAngle=multiplication,
    MinEdge=multiplication_2,
    MaxEdge=0)
panel_4 = Panel("1.40625*2")

mesh_brep = MeshBrep(Brep=list_item, Settings=settings_custom)
panel_5 = Panel(mesh_brep)
deconstruct_mesh = DeconstructMesh(Mesh=mesh_brep)  # -> Vertices, Faces, Colours, Normals
list_length = ListLength(List=deconstruct_mesh.Faces)
multiplication_3 = Multiplication(A=list_length, B=194)
panel_6 = Panel("C:\FREQUENCY_SPHERE_PART_0_ASPECT_RATIO_256_MIN_EDGE_3_513_MAX_ANGLE_11_25.OBJ")
mesh_join = MeshJoin(Meshes=flatten(mesh_brep))
panel_7 = Panel(mesh_join)
true_only_button = TrueOnlyButton(LastSaveLocalization="neutral,N")
_0 = SettingsCustom(
    StitchSeams=True,
    SimplePlanes=True,
    Refine=False,
    MinCount=0,
    MaxCount=0,
    AspectRatio=256,
    MaxDistance=0,
    MaxAngle=0,
    MinEdge=0,
    MaxEdge=0)
panel_8 = Panel(multiplication_3)
panel_9 = Panel(list_length)
boolean_toggle = BooleanToggle(True)
export_as = ExportAs(
    Geometry=mesh_join,
    FileLocation=panel_6,
    Overwrite=False,
    Export=False,
    CompMode=False,
    LastSaveLocalization="neutral,N")  # -> OK, ExportCommand
power_2 = Power(Value1=2, Value2=0.5, UseClamp=False)
colour_swatch = ColourSwatch(SwatchColor=RGB(0, 191, 191))
subtract = Subtract(Value1=power_2, Value2=1, UseClamp=False)
geometry_2 = Geometry()  # -> Position, Normal, Tangent, TrueNormal, Incoming, Parametric, Backfacing, Pointiness
dot_product = DotProduct(Vector1=geometry_2.Normal, Vector2=geometry_2.Incoming)  # -> Value, Vector
subtract_2 = Subtract(Value1=1, Value2=dot_product.Vector, UseClamp=False)

digit_scroller_8 = DigitScroller(Scroller_Digits=12, Scroller_Prefix="Digit Scroller", Scroller_Radix=2, Scroller_Value=4)
layer_weight = LayerWeight(Blend=0.5, Normal=geometry_2.Normal)  # -> Fresnel, Facing
digit_scroller_9 = DigitScroller(Scroller_Digits=12, Scroller_Prefix="Digit Scroller", Scroller_Radix=1, Scroller_Value=0.65625)
divide = Divide(Value1=digit_scroller_8, Value2="19.48046875", UseClamp=False)
subtract_3 = Subtract(Value1=1, Value2=layer_weight.Facing, UseClamp=False)
power_3 = Power(Value1=subtract_3, Value2=divide, UseClamp=False)
subtract_4 = Subtract(Value1=1, Value2=digit_scroller_9, UseClamp=False)
multiply = Multiply(Value1=power_3, Value2=subtract_4, UseClamp=False)
add = Add(Value1=multiply, Value2=1, UseClamp=False)
subtract_5 = Subtract(Value1=add, Value2=subtract_4, UseClamp=False)

gradient = Gradient(Vector=layer_weight.Facing, Gradient="Spherical")  # -> Color, Fac
split_ahsv = SplitAHSV(Colour=gradient.Color)  # -> Alpha, Hue, Saturation, Value
subtract_6 = Subtract(Value1=1, Value2=split_ahsv.Value, UseClamp=False)
panel_10 = Panel(split_ahsv.Value)
divide_2 = Divide(Value1=gradient.Fac, Value2=4, UseClamp=False)
multiply_2 = Multiply(Value1=split_ahsv.Value, Value2=power_2, UseClamp=False)
mapping_node = MappingNode(Vector=geometry_2.Normal, Location="1,1,0", Rotation=Vector(0, 0, 0), Scale="2,2,1")
subtract_7 = Subtract(Value1=1, Value2=gradient.Fac, UseClamp=False)
image = Image(
    Vector=geometry_2.Normal,
    DecalForward=0,
    DecalUsage=0,
    ImTexColorSpace="None",
    ImTexInterpolation="Closest",
    ImTexProjection="Flat",
    ImTexTextureExtension="Repeat",
    Image="C:\O\O_AIDIW_O_WIDIA_O\O_REDNELB_O_BLENDER_O\O____ΛATϽCAЯRΦ_ΦΛƎEƧS_GИNIЯR____O____ЯRIИNG_ƧSƎEΛΦ_ΦЯRAϽCTAΛ____O\1.2.3.4.16384...TIF.8BPC.GRAYA.4.4096.PNG")  # -> Color, Alpha
cross_product = CrossProduct(Vector1=geometry_2.Incoming, Vector2=geometry_2.Normal)  # -> Value, Vector
color_ramp = ColorRamp(
    Fac=subtract_7,
    StopColours=[ColourSwatch(SwatchColor=RGB(232, 232, 232)), ColourSwatch(SwatchColor=RGB(255, 255, 255))],
    StopPositions=[0, 1],
    Interpolation="Linear")  # -> Color, Alpha
dot_product_2 = DotProduct(Vector1=geometry_2.Normal, Vector2=geometry_2.Incoming)  # -> Value, Vector
subtract_8 = Subtract(Value1=1, Value2=dot_product_2.Value, UseClamp=False)
sphere = Sphere(Base=PlaneXY(0, 0, 0), Radius=1)
geometry_3 = Geometry(flatten(list_item))
subtract_9 = Subtract(Value1=subtract_8, Value2=0.5, UseClamp=False)
mesh_brep_2 = MeshBrep(
    Brep=geometry_3,
    Settings={GridMaxCount=0, GridMinCount=16, JaggedSeams=False, MaxEdgeLength=0, MinEdgeLength=0.0001, MinTolerance=0, Refine=True, RefineAngle=0, RelativeTolerance=0.65, SimplePlanes=True, Tolerance=0})
color2bw = Color2Bw(Color=dot_product_2.Value)
diffuse_bsdf = DiffuseBSDF(Color=RGB(0, 0, 0), Roughness=0, Normal=Vector(0, 0, 0))
transparent_bsdf = TransparentBSDF(Color=RGB(255, 255, 255))

output = Output(Surface=subtract_5, Volume=RGB(128, 128, 128), Displacement=Vector(0, 0, 0))
custom_preview = CustomPreview(
    Geometry=mesh_brep_2,
    Material={diffuse=RGB(255, 105, 180), emission=RGB(0, 0, 0), shine=0, specular=RGB(255, 255, 255), transparency=0})

blend = Blend(Closure1=transparent_bsdf, Closure2=diffuse_bsdf, Fac=geometry_2.Position)
infoglasses = InfoGlasses(Run=True, Language=0, assemSet=False, cateSet=False, showName=False)
