# Grasshopper definition XHꓨ.𖣠⚪ИNⓄⵙ✣ᗩᙏⵙꕤⓄᴥߦᗩ𖣓ᙁⵙꗳ𖣓ᗱᗴᙁᑐᑕᴥⵙᑐᑕ𖣓ИNᗩⵙИNⓄᙁⓄߦᗩ𖣓ИNⓄⵙↀⵙᗯⵙↀ⚭ᑎᔓᔕ𖣓ⵙ✻ᔓᔕИNⵙߦᴥᗱᗴⵙᔓᔕ⚪𔗢⚪🞋⚪𔗢⚪ᔓᔕⵙᗱᗴᴥߦⵙИNᔓᔕ✻ⵙ𖣓ᔓᔕᑎ⚭ↀⵙᗯⵙↀⵙⓄИN𖣓ᗩߦⓄᙁⓄИNⵙᗩИN𖣓ᑐᑕⵙᴥᑐᑕᙁᗱᗴ𖣓ꗳⵙᙁ𖣓ᗩߦᴥⓄꕤⵙᙏᗩ✣ⵙⓄИN⚪𖣠.GHX (Grasshopper 1.0.7)
# plug-ins: HoopSnake, Anemone, BullAnt, GhPolyhedra, NGon, BubalusGH2.0, Weaverbird, CurvePlus, Pufferfish, MeshEdit Components, MeshDual, SurfacePlus, Element

mesh_plane = MeshPlane(
    Boundary={Plane=Plane(origin=(0, 0, 0), x=(0, 0, 1), y=(1, 0, 0)), Size=Domain2(u=-1..1, v=-1..1)},
    WidthCount=1,
    HeightCount=1)  # -> Mesh, Area; disabled
weaverbird_s_sierpinski_triangles_subdiv = WeaverbirdsSierpinskiTrianglesSubdivision(MeshCurves=mesh_plane.Mesh, Level=4)  # disabled
plane_surface = PlaneSurface(Plane=Plane(origin=(0, 0, 0), x=(0, 0, 1), y=(1, 0, 0)), XSize=Domain(-1, 1), YSize=Domain(-1, 1))  # disabled
polyhedron = Polyhedron(Name="OCTAHEDRON", Plane=PlaneXY(0, 0, 0), Scale=1)  # -> Curves, Meshes, Solid; disabled
polyhedron_2 = Polyhedron(Name="CUBE", Plane=PlaneXY(0, 0, 0), Scale=1)  # -> Curves, Meshes, Solid; disabled
waterman = Waterman(Plane=PlaneXY(0, 0, 0), Root=1)  # -> Curves, Mesh; disabled
element_octahedron = ElementOctahedron(Radius=1)  # -> Polylines, OctahedronMesh; disabled
mesh_explode = MeshExplode(Mesh=weaverbird_s_sierpinski_triangles_subdiv, Interpolate=False)  # disabled
from_polylines = FromPolylines(Curves=polyhedron.Curves, Min_Triangulation=True)  # disabled
smooth = Smooth(Mesh=weaverbird_s_sierpinski_triangles_subdiv, Value=0.025, Iterations=0, Fixed=False)  # disabled
mesh_edges = MeshEdges(Mesh=weaverbird_s_sierpinski_triangles_subdiv)  # -> AllE, NakedE; disabled
ggnetworkpolygons = GgNetworkPolygons(Curves=mesh_edges.NakedE, PerimOrVoid=65536)  # disabled
relay = Relay(relay)  # disabled
mesh_explode_2 = MeshExplode(Mesh=relay, Interpolate=False)  # disabled
mesh_edges_2 = MeshEdges(Mesh=mesh_explode_2)  # -> AllE, NakedE; disabled
ggnetworkpolygons_2 = GgNetworkPolygons(Curves=mesh_edges_2.AllE, PerimOrVoid=65536)  # -> flatten(Cells); disabled
perimeter_surface = PerimeterSurface(Curve=ggnetworkpolygons_2)  # disabled
brep_join = BrepJoin(Breps=perimeter_surface)  # -> Breps, Closed; disabled
join_curves = JoinCurves(Curves=mesh_edges_2.AllE, Preserve=False)  # disabled
chamfer = Chamfer(Poly=join_curves, Chamfer=0.5)  # disabled
from_polylines_2 = FromPolylines(Curves=chamfer, Min_Triangulation=True)  # disabled
weaverbird_s_mesh_from_lines_weave_back = WeaverbirdsMeshFromLinesWeaveBack(MaximumValence=4)  # disabled
mesh_edges_3 = MeshEdges(Mesh=mesh_plane.Mesh)  # -> AllE, NakedE; disabled
mesh_edges_4 = MeshEdges(Mesh=mesh_explode_2)  # -> NakedEdges, InteriorEdges, NonManifoldEdges; disabled
ggnetworkpolygons_3 = GgNetworkPolygons(Curves=mesh_edges_3.AllE, PerimOrVoid=65536)  # -> flatten(Cells); disabled
perimeter_surface_2 = PerimeterSurface(Curve=chamfer)  # disabled
from_polylines_3 = FromPolylines(Curves=flatten(ggnetworkpolygons_3), Min_Triangulation=True)  # -> flatten(Mesh); disabled
mesh_explode_3 = MeshExplode(Mesh=relay, Interpolate=False)  # disabled
mesh_join = MeshJoin(Meshes=from_polylines_3)  # disabled
mesh_edges_5 = MeshEdges(Mesh=mesh_explode_3)  # -> AllE, NakedE; disabled
ggnetworkpolygons_4 = GgNetworkPolygons(Curves=mesh_edges_5.AllE, PerimOrVoid=65536)  # disabled
polyhedron_3 = Polyhedron(Name="OCTAHEDRON", Plane=PlaneXY(0, 0, 0), Scale=1)  # -> Curves, Meshes, Solid; disabled
power_of_2 = PowerOf2(Value="16")  # disabled
scale = Scale(Geometry=plane_surface, Center=Point(0, 0, 0), Factor=power_of_2)  # -> Geometry, Transform; disabled
scale_2 = Scale(Geometry=brep_join.Breps, Center=Point(0, 0, 0), Factor=power_of_2)  # -> Geometry, Transform; disabled
solid_difference = SolidDifference(BrepsA=scale.Geometry, BrepsB=scale_2.Geometry)  # disabled
scale_3 = Scale(Geometry=solid_difference, Center=Point(0, 0, 0), Factor=expr("1/X", power_of_2))  # -> Geometry, Transform; disabled
ngon_edges = NGonEdges()  # -> Edges, ID, NakedID, Normal, Naked, AllE; disabled
degree_2_smooth = Degree2Smooth(Polyline=ggnetworkpolygons_4, Iterations=0)  # -> flatten(Polyline); disabled
weaverbird_s_sierpinski_triangles_subdiv_2 = WeaverbirdsSierpinskiTrianglesSubdivision(MeshCurves=degree_2_smooth, Level=3)  # disabled
mesh_join_2 = MeshJoin(Meshes=flatten(weaverbird_s_sierpinski_triangles_subdiv_2))  # disabled
mesh_explode_4 = MeshExplode(Mesh=mesh_join_2, Interpolate=False)  # disabled
mesh_edges_6 = MeshEdges(Mesh=mesh_explode_4)  # -> AllE, NakedE; disabled
ggnetworkpolygons_5 = GgNetworkPolygons(Curves=flatten(mesh_edges_6.AllE), PerimOrVoid=65536)  # disabled
number_slider = Slider(2, range=0..10)  # disabled
degree_2_smooth_2 = Degree2Smooth(Polyline=flatten(ggnetworkpolygons_5), Iterations=0)  # disabled
weaverbird_s_dual_graph = WeaverbirdsDualGraph(MeshCurves=degree_2_smooth, DualMode=1)  # disabled
polygon = Polygon(Plane=PlaneXY(0, 0, 0), Radius=1, Segments=3, FilletRadius=0)  # -> Polygon, Length; disabled
polar_zonohedron = PolarZonohedron(Plane=PlaneXY(0, 0, 0), Frequency=4, Pitch=0.6154797087, Length=1)  # -> Curves, Mesh; disabled
ggnetworkpolygons_6 = GgNetworkPolygons(Curves=polyhedron_3.Curves, PerimOrVoid=4)  # -> flatten(Cells); disabled
brep_wireframe = BrepWireframe(Brep=polyhedron_3.Curves, Density=-1)  # disabled
mesh_difference = MeshDifference(MeshesA=scale.Geometry, MeshesB=scale_2.Geometry)  # disabled
meshdual = MeshDual(Mesh=degree_2_smooth, Center=0)  # disabled
from_polylines_4 = FromPolylines(Curves=meshdual, Min_Triangulation=True)  # disabled
from_polylines_5 = FromPolylines(Curves=scale_3.Geometry, Min_Triangulation=True)  # disabled
digit_scroller = DigitScroller(Scroller_Digits=12, Scroller_Prefix="Digit Scroller", Scroller_Radix=11, Scroller_Value=2)  # disabled
button = Button()  # disabled
polygon_2 = Polygon(Plane=PlaneXY(0, 0, 0), Radius=1, Segments=3, FilletRadius=0)  # -> Polygon, Length; disabled
fast_loop_start = FastLoopStart(Iterations=2, Data=polygon.Polygon)  # -> port, Counter, Data; disabled
loop_start = LoopStart(Repeat=digit_scroller, Trigger=button, Data=polygon.Polygon)  # -> port, Counter, Data; disabled
relay_2 = Relay(polygon_2.Polygon)  # disabled
explode = Explode(Curve=relay_2, Recursive=True)  # -> Segments, Vertices; disabled
relay_3 = Relay(loop_start.Data)  # disabled
polyhedron_4 = Polyhedron(Name="TRUNCATED RHOMBICUBOCTAHEDRON", Plane=PlaneXY(0, 0, 0), Scale=1)  # -> Curves, Meshes, Solid
area = Area(Geometry=relay_2)  # -> Area, Centroid; disabled
split_curves = SplitCurves(Curves=flatten(relay_2))  # -> flatten(Curves), Points; disabled
explode_2 = Explode(Curve=relay_3, Recursive=True)  # -> Segments, Vertices; disabled
quad_sphere = QuadSphere(Base=PlaneXY(0, 0, 0), Radius=6)
infoglasses = InfoGlasses(Run=True, Language=0)
area_2 = Area(Geometry=relay_3)  # -> Area, Centroid; disabled
list_item = ListItem(List=explode.Segments, Index=0, Wrap=True)  # -> Item, Item1, Item2; disabled
sphere = Sphere(Base=PlaneXY(0, 0, 0), Radius=1)  # disabled
list_item_2 = ListItem(List=explode_2.Segments, Index=0, Wrap=True)  # -> flatten(Item); disabled
list_item_3 = ListItem(List=explode_2.Segments, Index=1, Wrap=True)  # -> flatten(Item); disabled
list_item_4 = ListItem(List=explode_2.Segments, Index=2, Wrap=True)  # -> flatten(Item); disabled
circle_tantantan = CircleTanTanTan(CurveA=list_item.Item, CurveB=list_item.Item1, CurveC=list_item.Item2, Point=area.Centroid)  # disabled
waterman_2 = Waterman(Plane=PlaneXY(0, 0, 0), Root=19)  # -> Curves, Mesh
weaverbird_s_sierpinski_triangles_subdiv_3 = WeaverbirdsSierpinskiTrianglesSubdivision(MeshCurves=waterman_2.Curves, Level=4)
mesh_explode_5 = MeshExplode(Interpolate=False)
addngons = AddNGons(Mesh=weaverbird_s_sierpinski_triangles_subdiv_3, Pair=0)  # -> Polylines, Polylines_2, Mesh
smooth_2 = Smooth(Mesh=addngons.Mesh, Value=1, Iterations=64, Fixed=False)
deconstruct_mesh = DeconstructMesh(Mesh=smooth_2)  # -> Vertices, Faces, Colours, Normals
pull_point = PullPoint(Point=deconstruct_mesh.Vertices, Geometry=quad_sphere, ClosestOnly=True)  # -> ClosestPoint, Distance; disabled
construct_mesh = ConstructMesh(Vertices=pull_point.ClosestPoint, Faces=deconstruct_mesh.Faces, Colours=deconstruct_mesh.Colours)  # disabled
mesh_edges_7 = MeshEdges(Mesh=smooth_2)  # -> AllE, NakedE
ggnetworkpolygons_7 = GgNetworkPolygons(Curves=mesh_edges_7.AllE, PerimOrVoid=65536)
degree_2_smooth_3 = Degree2Smooth(Polyline=ggnetworkpolygons_7, Iterations=1)
curve_edit_points = CurveEditPoints(Curve=degree_2_smooth_3, Knots=True)  # -> Points, Tangents, Parameters; disabled
power_of_2_2 = PowerOf2(Value="7")  # disabled
merge = Merge(Data1=circle_tantantan, Data2=explode.Segments)  # disabled
circle_tantantan_2 = CircleTanTanTan(CurveA=list_item_2, CurveB=list_item_3, CurveC=list_item_4, Point=area_2.Centroid)  # -> flatten(Circle); disabled
deconstruct_mesh_2 = DeconstructMesh(Mesh=mesh_explode_5)  # -> Vertices, Faces, Colours, Normals; disabled
polyline = PolyLine(Vertices=deconstruct_mesh_2.Vertices, Closed=True)  # disabled
degree_2_smooth_4 = Degree2Smooth(Polyline=polyline, Iterations=2)  # disabled
from_polylines_6 = FromPolylines(Curves=degree_2_smooth_4, Min_Triangulation=True)  # disabled
deconstruct_mesh_3 = DeconstructMesh(Mesh=from_polylines_6)  # -> Vertices, Faces, Colours, Normals; disabled
pull_point_2 = PullPoint(Point=deconstruct_mesh_3.Vertices, Geometry=quad_sphere, ClosestOnly=True)  # -> ClosestPoint, Distance; disabled
construct_mesh_2 = ConstructMesh(Vertices=pull_point_2.ClosestPoint, Faces=deconstruct_mesh_3.Faces, Colours=deconstruct_mesh_3.Colours)  # disabled
from_polylines_7 = FromPolylines(Curves=waterman_2.Curves, Min_Triangulation=True)
pull_point_3 = PullPoint(Point=curve_edit_points.Points, Geometry=from_polylines_7, ClosestOnly=True)  # -> ClosestPoint, Distance; disabled
polyline_2 = PolyLine(Vertices=pull_point_3.ClosestPoint, Closed=True)  # disabled
scale_4 = Scale(Geometry=merge, Center=Point(0, 0, 0), Factor=expr("X*65536", 1))  # -> Geometry, Transform; disabled
divide_curves_on_intersects = DivideCurvesOnIntersects(Curves=scale_4.Geometry, Tolerance=7.629394531e-06)  # disabled
scale_5 = Scale(Geometry=relay_3, Center=Point(0, 0, 0), Factor=power_of_2_2)  # -> Geometry, Transform; disabled
scale_6 = Scale(Geometry=circle_tantantan_2, Center=Point(0, 0, 0), Factor=power_of_2_2)  # -> Geometry, Transform; disabled
scale_7 = Scale(Geometry=divide_curves_on_intersects, Center=Point(0, 0, 0), Factor=expr("X/65536", 1))  # -> Geometry, Transform; disabled
region_difference = RegionDifference(CurvesA=scale_5.Geometry, CurvesB=scale_6.Geometry)  # disabled
hoopsnake = HoopSnake(
    StartingData=polygon.Polygon,
    Data=region_difference,
    TerminationCondition=number_slider,
    Hoopsnake_Data_autoUpdate=False,
    Hoopsnake_Data_dataLimit=2147483647,
    Hoopsnake_Data_delay=0,
    Hoopsnake_Data_resetCounter=True,
    Hoopsnake_Data_updateView=False)  # -> Feedback, CumulativeFeedback, LoopsCounter, IterationsCounter; disabled
relay_4 = Relay(scale_7.Geometry)  # disabled
curve_middle = CurveMiddle(Curve=relay_4)  # disabled
vector_2pt = Vector2Pt(PointA=area.Centroid, PointB=curve_middle, Unitize=False)  # -> Vector, Length; disabled
angle = Angle(VectorA=Vector(0, 1, 0), VectorB=vector_2pt.Vector)  # -> Angle, Reflex; disabled
sort_list = SortList(Keys=angle.Angle, ValuesValuesA=relay_4)  # -> Keys, ValuesValuesA; disabled
scale_8 = Scale(Geometry=region_difference, Center=Point(0, 0, 0), Factor=expr("1/X", power_of_2_2))  # -> Geometry, Transform; disabled
sift_pattern = SiftPattern(List=sort_list.ValuesValuesA, SiftPattern=[0, 1, 2])  # -> Output0, Output1, Output2; disabled
clean_tree = CleanTree(RemoveNulls=True, RemoveInvalid=True, RemoveEmpty=False, Tree=sift_pattern.Output2)  # disabled
clean_tree_2 = CleanTree(RemoveNulls=True, RemoveInvalid=True, RemoveEmpty=False, Tree=sift_pattern.Output1)  # disabled
clean_tree_3 = CleanTree(RemoveNulls=True, RemoveInvalid=True, RemoveEmpty=False, Tree=sift_pattern.Output0)  # disabled
polyhedra_categories = PolyhedraCategories()  # disabled
loop_end = LoopEnd(port=loop_start.port, Exit=False, Data=scale_8.Geometry, TimeOutVal=0, pausedState=False, state="Constant output")  # disabled
digit_scroller_2 = DigitScroller(Scroller_Digits=12, Scroller_Prefix="Digit Scroller", Scroller_Radix=11, Scroller_Value=149)  # disabled
fast_loop_end = FastLoopEnd(port=fast_loop_start.port, Exit=False, Data=scale_8.Geometry, RecordData=True, TimeOutVal=0)  # disabled
curve_middle_2 = CurveMiddle(Curve=clean_tree_3)  # disabled
list_item_5 = ListItem(List=polyhedra_categories, Index=0, Wrap=True)  # disabled
polyhedra_names = PolyhedraNames(Category=list_item_5)  # disabled
list_item_6 = ListItem(List=polyhedra_names, Index=digit_scroller_2, Wrap=True)  # disabled
circle_tantantan_3 = CircleTanTanTan(CurveA=clean_tree_3, CurveB=clean_tree_2, CurveC=clean_tree, Point=curve_middle_2)  # disabled
merge_2 = Merge(Data1=sort_list.ValuesValuesA, Data2=circle_tantantan_3)  # disabled
