# Grasshopper definition XHG.⠀⠀⠀⠀◯⠀옷ߦᗩᴥᕤᕦ⠀◯⠀ᗝᗱᗴߦᗩᙏ⠀◯⠀ᗱᗴᙁ✤ᴥᑎ✤⠀◯⠀ᗱᗴᴥᑎ✤ᗩᗯᴥᑎᑐᑕ⠀◯⠀⠀⠀⠀ⵙ⠀⠀⠀⠀◯⠀ᑐᑕᑎᴥᗯᗩ✤ᑎᴥᗱᗴ⠀◯⠀✤ᑎᴥ✤ᙁᗱᗴ⠀◯⠀ᙏᗩߦᗱᗴᗝ⠀◯⠀ᕤᕦᴥᗩߦ옷⠀◯⠀⠀⠀⠀.GHX (Grasshopper 1.0.7)
# plug-ins: Pufferfish, CurvePlus

digit_scroller = DigitScroller(Scroller_Digits=12, Scroller_Prefix="Digit Scroller", Scroller_Radix=11, Scroller_Value=20)
range = Range(Domain=Domain(0, 1), Steps=digit_scroller)
digit_scroller_2 = DigitScroller(Scroller_Digits=12, Scroller_Prefix="Digit Scroller", Scroller_Radix=1, Scroller_Value=1.5)
digit_scroller_3 = DigitScroller(Scroller_Digits=12, Scroller_Prefix="Digit Scroller", Scroller_Radix=1, Scroller_Value=1)
digit_scroller_4 = DigitScroller(Scroller_Digits=12, Scroller_Prefix="Digit Scroller", Scroller_Radix=11, Scroller_Value=50)
digit_scroller_5 = DigitScroller(Scroller_Digits=12, Scroller_Prefix="Digit Scroller", Scroller_Radix=1, Scroller_Value=0.00070038828)
digit_scroller_6 = DigitScroller(Scroller_Digits=12, Scroller_Prefix="Digit Scroller", Scroller_Radix=10, Scroller_Value=2)
digit_scroller_7 = DigitScroller(Scroller_Digits=12, Scroller_Prefix="Digit Scroller", Scroller_Radix=1, Scroller_Value=1)
digit_scroller_8 = DigitScroller(Scroller_Digits=12, Scroller_Prefix="Digit Scroller", Scroller_Radix=10, Scroller_Value=2)
graph = GraphMapper(range, x0=0, x1=1, y0=0, y1=1, container_name="Sine", Equation_px=[0, 1], Equation_py=[0, 1])
series = Series(Start=0, Step=digit_scroller_5, Count=digit_scroller_4)
expression = Expression(X=series, Expression="X+1/2*x^2+1/6*x^3+1/24*x^4+1/120*x^5+1/720*x^6+1/5040*x^7+1/40320*x^8++1/322560*x^9")
quick_graph = QuickGraph(expression, SortOrder=0)
expression_2 = Expression(
    X=series,
    O_EZIS_O_SIZE_O=digit_scroller_7,
    O_REWOP_TOOR_O_ROOT_POWER_O=digit_scroller_6,
    O_REWOP_O_POWER_O=digit_scroller_8,
    Expression="(O_EZIS_O_SIZE_O^O_REWOP_O_POWER_O-abs(X-1)^O_REWOP_O_POWER_O)^(1/O_REWOP_TOOR_O_ROOT_POWER_O)")
quick_graph_2 = QuickGraph(expression_2, SortOrder=0)
dup = DuplicateData(Data=digit_scroller_3, Number=digit_scroller_4, Order=True)
quick_graph_3 = QuickGraph(graph, SortOrder=0)
expression_3 = Expression(X=series, Expression="asin((x-.5)*2)/(2*atan(1))/2+.5")
quick_graph_4 = QuickGraph(expression_3, SortOrder=0)
series_2 = Series(Start=0, Step=digit_scroller_2, Count=digit_scroller)
graph_2 = GraphMapper(series, x0=0, x1=0.0176, y0=0, y1=0.0625, container_name="Sine", Equation_px=[0, 1], Equation_py=[0, 1])
graph_3 = GraphMapper(series, x0=0, x1=1, y0=0, y1=1, A=1, B=0, container_name="Linear")
digit_scroller_9 = DigitScroller(Scroller_Digits=12, Scroller_Prefix="Digit Scroller", Scroller_Radix=11, Scroller_Value=4)
quick_graph_5 = QuickGraph(graph_3, SortOrder=0)
stream_filter = StreamFilter(Gate=digit_scroller_9, Stream0=graph_3, Stream1=graph_2, Stream2=expression_2, Stream3=expression_3, Stream4=expression)
turtle = DotNETVBScriptLEGACY(Forward=dup, Left=stream_filter)  # -> out, Points; inputs Forward: list, Left: list
# ---------- turtle: VB ----------
    Dim i As Integer
    Dim dir As New On3dVector(1, 0, 0)    
    Dim pos As New On3dVector(0, 0, 0) 
    Dim axis As New On3dVector(0, 0, 1)
    Dim pnts As New List(Of On3dVector)

    pnts.Add(pos)
    
    For i = 0 To Forward.Count() - 1
      Dim P As New On3dVector
      dir.Rotate(Left(i), axis)      
      P = dir * Forward(i) + pnts(i)
      pnts.Add(P)
    Next
    
    Points = pnts
# ---------- end turtle ----------
digit_scroller_10 = DigitScroller(Scroller_Digits=12, Scroller_Prefix="Digit Scroller", Scroller_Radix=11, Scroller_Value=11)
digit_scroller_11 = DigitScroller(Scroller_Digits=12, Scroller_Prefix="Digit Scroller", Scroller_Radix=8, Scroller_Value=0.0861)
digit_scroller_12 = DigitScroller(Scroller_Digits=12, Scroller_Prefix="Digit Scroller", Scroller_Radix=8, Scroller_Value=0.125)
digit_scroller_13 = DigitScroller(Scroller_Digits=12, Scroller_Prefix="Digit Scroller", Scroller_Radix=1, Scroller_Value=1)
digit_scroller_14 = DigitScroller(Scroller_Digits=12, Scroller_Prefix="Digit Scroller", Scroller_Radix=11, Scroller_Value=61)
digit_scroller_15 = DigitScroller(Scroller_Digits=12, Scroller_Prefix="Digit Scroller", Scroller_Radix=1, Scroller_Value=0.00100038828)
intcrv = Interpolate(Vertices=turtle.Points, Degree=digit_scroller_10, Periodic=False)  # -> Curve, Length, Domain
curvature = Curvature(Curve=intcrv.Curve, Parameter=digit_scroller_4)  # -> Point, Curvature, Curvature_2
rotate = Rotate(Geometry=intcrv.Curve, Angle=3.141592654, Plane=PlaneXY(0, 0, 0))  # -> Geometry, Transform
construct_domain = ConstructDomain(DomainStart=0, DomainEnd=digit_scroller_11)
construct_domain_2 = ConstructDomain(DomainStart=0, DomainEnd=digit_scroller_11)
darc = DeconstructArc(Arc=curvature.Curvature_2)  # -> BasePlane, Radius, Angle
panel = Panel(darc.Radius)
series_3 = Series(Start=0, Step=digit_scroller_15, Count=digit_scroller_14)
dup_2 = DuplicateData(Data=digit_scroller_13, Number=digit_scroller_14, Order=True)
point_on_curve = PointOnCurve(intcrv.Curve, parameter=1)
rotate_direction = RotateDirection(Geometry=intcrv.Curve, Center=point_on_curve, From=Vector(0, -1, 0), To=Vector(0, 1, 0))  # -> Geometry, Transform
graph_4 = GraphMapper(
    series_3,
    x0=0,
    x1=1,
    y0=0,
    y1=1,
    A=1,
    B=0,
    container_name="Linear",
    Graph_x0=0.25,
    Graph_x1=0.75,
    Graph_y0=0.25,
    Graph_y1=0.75)
digit_scroller_16 = DigitScroller(Scroller_Digits=12, Scroller_Prefix="Digit Scroller", Scroller_Radix=11, Scroller_Value=1)
digit_scroller_17 = DigitScroller(Scroller_Digits=12, Scroller_Prefix="Digit Scroller", Scroller_Radix=11, Scroller_Value=118)
join_curves = JoinCurves(Curves=[rotate_direction.Geometry, intcrv.Curve], Preserve=False)
bounding_rectangle = BoundingRectangle(Geometry=join_curves, Plane=PlaneXY(0, 0, 0), unioned=True)
curve_graph_mapper = CurveGraphMapper(
    Curves=join_curves,
    Rectangle=bounding_rectangle,
    Values=series_3,
    XAxis=construct_domain_2,
    YAxis=construct_domain,
    Flip=False,
    Snap=False,
    TextSize=1)  # -> Mapped, GraphCurves, GraphPoints, ValueLines, ValuePoints, MappedLines, MappedPoints, Boundary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
panel_2 = Panel(curve_graph_mapper.Mapped)
turtle_2 = DotNETVBScriptLEGACY(Forward=dup_2, Left=curve_graph_mapper.Mapped)  # -> out, Points; inputs Forward: list, Left: list; same code as turtle
quick_graph_6 = QuickGraph(curve_graph_mapper.Mapped, SortOrder=0)
quick_graph_7 = QuickGraph(curve_graph_mapper.GraphCurves, SortOrder=0)
quick_graph_8 = QuickGraph(curve_graph_mapper.GraphPoints, SortOrder=0)
quick_graph_9 = QuickGraph(curve_graph_mapper.ValueLines, SortOrder=0)
quick_graph_10 = QuickGraph(curve_graph_mapper.ValuePoints, SortOrder=0)
quick_graph_11 = QuickGraph(curve_graph_mapper.MappedLines, SortOrder=0)
quick_graph_12 = QuickGraph(curve_graph_mapper.MappedPoints, SortOrder=0)
point_on_curve_2 = PointOnCurve(join_curves, parameter=1)
rotate_direction_2 = RotateDirection(Geometry=turtle_2.Points, Center=Point(0, 0, 0), From=Vector(1, 0, 0), To=Vector(0, 1, 0))  # -> Geometry, Transform
mirror = Mirror(Geometry=turtle_2.Points, Plane=PlaneYZ(0, 0, 0))  # -> Geometry, Transform
intcrv_2 = Interpolate(Vertices=rotate_direction_2.Geometry, Degree=3, Periodic=False)  # -> Curve, Length, Domain
curvature_graph = CurvatureGraph(Curve=[join_curves, intcrv_2.Curve], Density=digit_scroller_16, Scale=digit_scroller_17)
derivatives = Derivatives(Curve=[join_curves, intcrv_2.Curve], Parameter=point_on_curve_2)  # -> Point, FirstDerivative, SecondDerivative, ThirdDerivative, FourthDerivative, FifthDerivative, SixthDerivative
list = ValueList({"Default": 0, "Below": -1, "Above": 1}, selected="Default")
vector_display = VectorDisplay(
    Anchor=derivatives.Point,
    Vector=[derivatives.ThirdDerivative, derivatives.FirstDerivative, derivatives.SecondDerivative, derivatives.FourthDerivative, derivatives.FifthDerivative, derivatives.SixthDerivative])
c_script = CSharpScript(
    cList=[intcrv_2.Curve, join_curves],
    t=Slider(1, range=0..1),
    derivCount=Slider(16, range=0..16),
    crvEvaluation=list,
    unitize=Toggle(True),
    displayFactor=Slider(9.7, range=1..30))  # -> out, theBiggestMessageOfTheDayIsSimplyThatOne, pointAtTList, derivativeVectorTree, curvatureVectorTree; inputs cList: list of Curve, t: Double, derivCount: Int32, crvEvaluation: Int32, unitize: Boolean, displayFactor: Double
# ---------- c_script: C# ----------
    cList = cList.Where(x => x != null).ToList();
    if(!cList.Any())return;

    DataTree<Vector3d> vTree = new DataTree<Vector3d>();
    DataTree<Vector3d> vcTree = new DataTree<Vector3d>();

    List<Point3d> pList = new List<Point3d>();

    switch(crvEvaluation){
      case 0: ces = CurveEvaluationSide.Default; break;
      case -1: ces = CurveEvaluationSide.Below; break;
      case 1: ces = CurveEvaluationSide.Above; break;
    }

    for(int i = 0; i < cList.Count; i++){
      Curve crv = cList[i];
      crv.Domain = new Interval(0, 1);
      Point3d pt = crv.PointAt(t);
      pList.Add(pt);

      Vector3d[] vSet = crv.DerivativeAt(t, derivCount, ces);
      Vector3d crvC = crv.CurvatureAt(t);
      vcTree.Add(crvC, new GH_Path(i));

      for(int j = 0; j < vSet.Length;j++){
        Vector3d v = vSet[j];
        if(v == Vector3d.Unset) continue;
        if(unitize){
          v.Unitize(); v *= displayFactor;
        }
        vTree.Add(v, new GH_Path(i));
      }
    }

    pointAtTList = pList;
    derivativeVectorTree = vTree;
    curvatureVectorTree = vcTree;
# ---------- c_script: C# additional code ----------
  public CurveEvaluationSide ces;
# ---------- end c_script ----------
vdis = VectorDisplay(Anchor=simplify(graft(c_script.pointAtTList)), Vector=c_script.derivativeVectorTree)
vdis_2 = VectorDisplay(Anchor=simplify(graft(c_script.pointAtTList)), Vector=c_script.curvatureVectorTree)
