# Grasshopper definition XHG.⠀⠀⠀⠀⠀⠀⠀⠀⠀⠀⠀⠀⠀⠀⠀⠀ⵙ⠀ᗱᗴ⠀ⵙ⠀ᗯ⠀ⵙ⠀ᴥ⠀ⵙ⠀ᑎ⠀ⵙ⠀ᑐᑕ⠀ⵙ⠀⠀⠀⠀◯⠀⠀⠀⠀ⵙ⠀✤⠀ⵙ⠀ИN⠀ⵙ⠀ᗱᗴ⠀ⵙ⠀ᕤᕦ⠀ⵙ⠀ИN⠀ⵙ⠀ᗩ⠀ⵙ⠀✤⠀ⵙ⠀⠀⠀⠀⠀⠀⠀⠀⠀⠀⠀⠀⠀⠀⠀⠀◯⠀⠀⠀⠀⠀⠀⠀⠀⠀⠀⠀⠀⠀⠀⠀⠀ⵙ⠀⠀⠀⠀⠀⠀⠀⠀⠀⠀⠀⠀⠀⠀⠀⠀◯⠀⠀⠀⠀⠀⠀⠀⠀⠀⠀⠀⠀⠀⠀⠀⠀ⵙ⠀✤⠀ⵙ⠀ᗩ⠀ⵙ⠀ИN⠀ⵙ⠀ᕤᕦ⠀ⵙ⠀ᗱᗴ⠀ⵙ⠀ИN⠀ⵙ⠀✤⠀ⵙ⠀⠀⠀⠀◯⠀⠀⠀⠀ⵙ⠀ᑐᑕ⠀ⵙ⠀ᑎ⠀ⵙ⠀ᴥ⠀ⵙ⠀ᗯ⠀ⵙ⠀ᗱᗴ⠀ⵙ⠀⠀⠀⠀⠀⠀⠀⠀⠀⠀⠀⠀⠀⠀⠀⠀.GHX (Grasshopper 1.0.7)

line_sdl = LineSDL(Start=Point(0, 0, 0), Direction=Vector(1, 1, 0), Length=1.414213562)
circle = Circle(Plane=PlaneXY(0, 0, 0), Radius=0.5)
flip_curve = FlipCurve(Curve=circle)  # -> Curve, Flag
evaluate_length = EvaluateLength(Curve=flip_curve.Curve, Length=0.9375, Normalized=True)  # -> Point, Tangent, Parameter
divide_curves_on_intersects = DivideCurvesOnIntersects(Curves=[flip_curve.Curve, line_sdl], Tolerance=0)
list_item = ListItem(List=divide_curves_on_intersects, Index=2, Wrap=False)
flip_curve_2 = FlipCurve(Curve=list_item)  # -> Curve, Flag
digit_scroller = DigitScroller(Scroller_Digits=12, Scroller_Prefix=" ", Scroller_Radix=1, Scroller_Value=0.25)
number_slider = Slider(0.333333, range=0..1)
evaluate_length_2 = EvaluateLength(Curve=flip_curve_2.Curve, Length=expr("1-X", number_slider), Normalized=True)  # -> Point, Tangent, Parameter
line_sdl_2 = LineSDL(Start=Point(0, 0, 0), Direction=Vector(1, 0, 0), Length=2)
evaluate_length_3 = EvaluateLength(Curve=line_sdl_2, Length=0.5, Normalized=True)  # -> Point, Tangent, Parameter
line_sdl_3 = LineSDL(Start=Point(2, 0, 0), Direction=Vector(-1, 1, 0), Length=1.414213562)
circle_2 = Circle(Plane=PlaneXY(2, 0, 0), Radius=0.5)
flip_curve_3 = FlipCurve(Curve=circle_2)  # -> Curve, Flag
evaluate_length_4 = EvaluateLength(Curve=flip_curve_3.Curve, Length=0.5625, Normalized=True)  # -> Point, Tangent, Parameter
divide_curves_on_intersects_2 = DivideCurvesOnIntersects(Curves=[flip_curve_3.Curve, line_sdl_3], Tolerance=0)
list_item_2 = ListItem(List=divide_curves_on_intersects_2, Index=2, Wrap=False)
evaluate_length_5 = EvaluateLength(Curve=list_item_2, Length=number_slider, Normalized=True)  # -> Point, Tangent, Parameter
merge = Merge(
    Data1=flatten(evaluate_length_3.Point),
    Data2=flatten(evaluate_length_4.Point),
    Data3=flatten(evaluate_length_5.Point),
    Data4=flatten(evaluate_length_2.Point),
    Data5=flatten(evaluate_length.Point),
    Data6=flatten(evaluate_length_3.Point))
merge_2 = Merge(
    Data1=flatten(evaluate_length_3.Tangent),
    Data2=flatten(evaluate_length_4.Tangent),
    Data3=flatten(evaluate_length_5.Tangent),
    Data4=flatten(evaluate_length_2.Tangent),
    Data5=flatten(evaluate_length.Tangent),
    Data6=flatten(evaluate_length_3.Tangent))
tangent_curve = TangentCurve(Vertices=merge, Tangents=merge_2, Blend=digit_scroller, Degree=3)  # -> Curve, Length, Domain

digit_scroller_2 = DigitScroller(Scroller_Digits=12, Scroller_Prefix=" ", Scroller_Radix=1, Scroller_Value=0.03125)
digit_scroller_3 = DigitScroller(Scroller_Digits=12, Scroller_Prefix=" ", Scroller_Radix=11, Scroller_Value=256)
digit_scroller_4 = DigitScroller(Scroller_Digits=12, Scroller_Prefix=" ", Scroller_Radix=11, Scroller_Value=90)
create_material = CreateMaterial(Diffuse=RGB(222, 222, 222), Specular=RGB(0, 255, 255), Emission=RGB(0, 0, 0), Transparency=0.5, Shine=100)
create_material_2 = CreateMaterial(Diffuse=RGB(247, 247, 247), Specular=RGB(0, 255, 255), Emission=RGB(0, 0, 0), Transparency=0.5, Shine=100)
create_material_3 = CreateMaterial(Diffuse=RGB(176, 176, 176), Specular=RGB(0, 255, 255), Emission=RGB(0, 0, 0), Transparency=0.5, Shine=100)
curve = Curve(graft(tangent_curve.Curve))
length = Length(Curve=curve)
custom_preview = CustomPreview(Geometry=curve, Material=create_material_3)
curvature_graph = CurvatureGraph(Curve=curve, Density=1, Scale=digit_scroller_4)  # disabled
number = Number(1024)
divide_curve = DivideCurve(Curve=curve, Count=number, Kinks=False)  # -> Points, Tangents, Parameters
curvature = Curvature(Curve=curve, Parameter=divide_curve.Parameters)  # -> Point, Curvature, Curvature_2
deconstruct_arc = DeconstructArc(Arc=curvature.Curvature_2)  # -> BasePlane, Radius, Angle
line = Line(StartPoint=curvature.Point, EndPoint=deconstruct_arc.BasePlane)
one_over_x = OneOverX(Value=deconstruct_arc.Radius)
expression = Expression(O=one_over_x, Expression="FORMAT(\"{0:R}\",O)")  # disabled
panel = Panel(expression)
quick_graph = QuickGraph(one_over_x, SortOrder=0)
bounds = Bounds(Numbers=one_over_x)
remap_numbers = RemapNumbers(Value=one_over_x, Source=bounds, Target=Domain(0, 1))  # -> Mapped, Clipped
multiplication = Multiplication(A=length, B=remap_numbers.Mapped)
multiplication_2 = Multiplication(A=multiplication, B=digit_scroller_2)
line_sdl_4 = LineSDL(Start=curvature.Point, Direction=curvature.Curvature, Length=expr("-X", multiplication_2))
evaluate_length_6 = EvaluateLength(Curve=line_sdl_4, Length=1, Normalized=True)  # -> Point, Tangent, Parameter
interpolate = Interpolate(Vertices=evaluate_length_6.Point, Degree=1, Periodic=False, KnotStyle=2)  # -> Curve, Length, Domain
custom_preview_2 = CustomPreview(Geometry=line_sdl_4, Material=create_material_2)
number_2 = Number(number)
curve_2 = Curve(interpolate.Curve)
custom_preview_3 = CustomPreview(Geometry=curve_2, Material=create_material)

expression_2 = Expression(O=deconstruct_arc.Radius, Expression="FORMAT(\"{0:R}\",O)")  # disabled
panel_2 = Panel(expression_2)

replace_nulls = ReplaceNulls(Items=one_over_x, Replacements=0)  # -> Items, Count
relative_differences = RelativeDifferences(Values=replace_nulls.Items)
list_length = ListLength(List=relative_differences)
series = Series(Start=1, Step=1, Count=expr("X-1", list_length))
list_item_3 = ListItem(List=relative_differences, Index=series, Wrap=False)

digit_scroller_5 = DigitScroller(Scroller_Digits=12, Scroller_Prefix=" ", Scroller_Radix=1, Scroller_Value=0.03125)
bounds_2 = Bounds(Numbers=list_item_3)
remap_numbers_2 = RemapNumbers(Value=list_item_3, Source=bounds_2, Target=Domain(-1, 1))  # -> Mapped, Clipped
multiplication_3 = Multiplication(A=length, B=remap_numbers_2.Mapped)
multiplication_4 = Multiplication(A=multiplication_3, B=digit_scroller_5)

expression_3 = Expression(O=list_item_3, Expression="FORMAT(\"{0:R}\",O)")  # disabled
panel_3 = Panel(expression_3)

replace_nulls_2 = ReplaceNulls(Items=list_item_3, Replacements=0)  # -> Items, Count
relative_differences_2 = RelativeDifferences(Values=replace_nulls_2.Items)
list_length_2 = ListLength(List=relative_differences_2)
series_2 = Series(Start=1, Step=1, Count=expr("X-1", list_length_2))
list_item_4 = ListItem(List=relative_differences_2, Index=series_2, Wrap=False)

digit_scroller_6 = DigitScroller(Scroller_Digits=12, Scroller_Prefix=" ", Scroller_Radix=1, Scroller_Value=0.03125)
bounds_3 = Bounds(Numbers=list_item_4)
remap_numbers_3 = RemapNumbers(Value=list_item_4, Source=bounds_3, Target=Domain(-1, 1))  # -> Mapped, Clipped
multiplication_5 = Multiplication(A=length, B=remap_numbers_3.Mapped)
multiplication_6 = Multiplication(A=multiplication_5, B=digit_scroller_6)

expression_4 = Expression(O=list_item_4, Expression="FORMAT(\"{0:R}\",O)")  # disabled
panel_4 = Panel(expression_4)

replace_nulls_3 = ReplaceNulls(Items=list_item_4, Replacements=0)  # -> Items, Count
relative_differences_3 = RelativeDifferences(Values=replace_nulls_3.Items)
list_length_3 = ListLength(List=relative_differences_3)
series_3 = Series(Start=1, Step=1, Count=expr("X-1", list_length_3))
list_item_5 = ListItem(List=relative_differences_3, Index=series_3, Wrap=False)

digit_scroller_7 = DigitScroller(Scroller_Digits=12, Scroller_Prefix=" ", Scroller_Radix=1, Scroller_Value=0.5)
bounds_4 = Bounds(Numbers=list_item_5)
remap_numbers_4 = RemapNumbers(Value=list_item_5, Source=bounds_4, Target=Domain(-1, 1))  # -> Mapped, Clipped
multiplication_7 = Multiplication(A=length, B=remap_numbers_4.Mapped)
multiplication_8 = Multiplication(A=multiplication_7, B=digit_scroller_7)

expression_5 = Expression(O=list_item_5, Expression="FORMAT(\"{0:R}\",O)")  # disabled
panel_5 = Panel(expression_5)

replace_nulls_4 = ReplaceNulls(Items=list_item_5, Replacements=0)  # -> Items, Count
relative_differences_4 = RelativeDifferences(Values=replace_nulls_4.Items)
list_length_4 = ListLength(List=relative_differences_4)
series_4 = Series(Start=1, Step=1, Count=expr("X-1", list_length_4))
list_item_6 = ListItem(List=relative_differences_4, Index=series_4, Wrap=False)

digit_scroller_8 = DigitScroller(Scroller_Digits=12, Scroller_Prefix=" ", Scroller_Radix=1, Scroller_Value=0.25)
bounds_5 = Bounds(Numbers=list_item_6)
remap_numbers_5 = RemapNumbers(Value=list_item_6, Source=bounds_5, Target=Domain(-1, 1))  # -> Mapped, Clipped
multiplication_9 = Multiplication(A=length, B=remap_numbers_5.Mapped)
multiplication_10 = Multiplication(A=multiplication_9, B=digit_scroller_8)

expression_6 = Expression(O=list_item_6, Expression="FORMAT(\"{0:R}\",O)")  # disabled
panel_6 = Panel(expression_6)

replace_nulls_5 = ReplaceNulls(Items=list_item_6, Replacements=0)  # -> Items, Count
relative_differences_5 = RelativeDifferences(Values=replace_nulls_5.Items)
list_length_5 = ListLength(List=relative_differences_5)
series_5 = Series(Start=1, Step=1, Count=expr("X-1", list_length_5))
list_item_7 = ListItem(List=relative_differences_5, Index=series_5, Wrap=False)

digit_scroller_9 = DigitScroller(Scroller_Digits=12, Scroller_Prefix=" ", Scroller_Radix=2, Scroller_Value=50)
bounds_6 = Bounds(Numbers=list_item_7)
remap_numbers_6 = RemapNumbers(Value=list_item_7, Source=bounds_6, Target=Domain(-1, 1))  # -> Mapped, Clipped
multiplication_11 = Multiplication(A=length, B=remap_numbers_6.Mapped)
multiplication_12 = Multiplication(A=multiplication_11, B=digit_scroller_9)

expression_7 = Expression(O=list_item_7, Expression="FORMAT(\"{0:R}\",O)")  # disabled
panel_7 = Panel(expression_7)

replace_nulls_6 = ReplaceNulls(Items=list_item_7, Replacements=0)  # -> Items, Count
relative_differences_6 = RelativeDifferences(Values=replace_nulls_6.Items)
list_length_6 = ListLength(List=relative_differences_6)
series_6 = Series(Start=1, Step=1, Count=expr("X-1", list_length_6))
list_item_8 = ListItem(List=relative_differences_6, Index=series_6, Wrap=False)

digit_scroller_10 = DigitScroller(Scroller_Digits=12, Scroller_Prefix=" ", Scroller_Radix=2, Scroller_Value=0.25)
bounds_7 = Bounds(Numbers=list_item_8)
remap_numbers_7 = RemapNumbers(Value=list_item_8, Source=bounds_7, Target=Domain(-1, 1))  # -> Mapped, Clipped
multiplication_13 = Multiplication(A=length, B=remap_numbers_7.Mapped)
multiplication_14 = Multiplication(A=multiplication_13, B=digit_scroller_10)

expression_8 = Expression(O=list_item_8, Expression="FORMAT(\"{0:R}\",O)")  # disabled
panel_8 = Panel(expression_8)

replace_nulls_7 = ReplaceNulls(Items=list_item_8, Replacements=0)  # -> Items, Count
relative_differences_7 = RelativeDifferences(Values=replace_nulls_7.Items)
list_length_7 = ListLength(List=relative_differences_7)
series_7 = Series(Start=1, Step=1, Count=expr("X-1", list_length_7))
list_item_9 = ListItem(List=relative_differences_7, Index=series_7, Wrap=False)

digit_scroller_11 = DigitScroller(Scroller_Digits=12, Scroller_Prefix=" ", Scroller_Radix=3, Scroller_Value=990)
bounds_8 = Bounds(Numbers=list_item_9)
remap_numbers_8 = RemapNumbers(Value=list_item_9, Source=bounds_8, Target=Domain(-1, 1))  # -> Mapped, Clipped
multiplication_15 = Multiplication(A=length, B=remap_numbers_8.Mapped)
multiplication_16 = Multiplication(A=multiplication_15, B=digit_scroller_11)

expression_9 = Expression(O=list_item_9, Expression="FORMAT(\"{0:R}\",O)")  # disabled
panel_9 = Panel(expression_9)

explode = Explode(Curve=curve_2, Recursive=True)  # -> Segments, Vertices
evaluate_length_7 = EvaluateLength(Curve=explode.Segments, Length=0.5, Normalized=True)  # -> Point, Tangent, Parameter
curve_closest_point = CurveClosestPoint(Point=evaluate_length_7.Point, Curve=curve)  # -> Point, Parameter, Distance
line_2 = Line(StartPoint=curve_closest_point.Point, EndPoint=evaluate_length_7.Point)

quick_graph_2 = QuickGraph(list_item_3, SortOrder=0)
create_material_4 = CreateMaterial(Diffuse=RGB(214, 214, 214), Specular=RGB(0, 255, 255), Emission=RGB(0, 0, 0), Transparency=0.5, Shine=100)
create_material_5 = CreateMaterial(Diffuse=RGB(240, 240, 240), Specular=RGB(0, 255, 255), Emission=RGB(0, 0, 0), Transparency=0.5, Shine=100)
line_sdl_5 = LineSDL(Start=evaluate_length_7.Point, Direction=line_2, Length=expr("ABS(X)", multiplication_4))
evaluate_length_8 = EvaluateLength(Curve=line_sdl_5, Length=1, Normalized=True)  # -> Point, Tangent, Parameter
interpolate_2 = Interpolate(Vertices=evaluate_length_8.Point, Degree=1, Periodic=False, KnotStyle=2)  # -> Curve, Length, Domain
custom_preview_4 = CustomPreview(Geometry=interpolate_2.Curve, Material=create_material_4)
custom_preview_5 = CustomPreview(Geometry=line_sdl_5, Material=create_material_5)

explode_2 = Explode(Curve=interpolate_2.Curve, Recursive=True)  # -> Segments, Vertices
evaluate_length_9 = EvaluateLength(Curve=explode_2.Segments, Length=0.5, Normalized=True)  # -> Point, Tangent, Parameter
curve_closest_point_2 = CurveClosestPoint(Point=evaluate_length_9.Point, Curve=curve)  # -> Point, Parameter, Distance
line_3 = Line(StartPoint=curve_closest_point_2.Point, EndPoint=evaluate_length_9.Point)

quick_graph_3 = QuickGraph(list_item_4, SortOrder=0)
create_material_6 = CreateMaterial(Diffuse=RGB(207, 207, 207), Specular=RGB(0, 255, 255), Emission=RGB(0, 0, 0), Transparency=0.5, Shine=100)
create_material_7 = CreateMaterial(Diffuse=RGB(232, 232, 232), Specular=RGB(0, 255, 255), Emission=RGB(0, 0, 0), Transparency=0.5, Shine=100)
line_sdl_6 = LineSDL(Start=evaluate_length_9.Point, Direction=line_3, Length=expr("ABS(X)", multiplication_6))
evaluate_length_10 = EvaluateLength(Curve=line_sdl_6, Length=1, Normalized=True)  # -> Point, Tangent, Parameter
interpolate_3 = Interpolate(Vertices=evaluate_length_10.Point, Degree=1, Periodic=False, KnotStyle=2)  # -> Curve, Length, Domain
custom_preview_6 = CustomPreview(Geometry=interpolate_3.Curve, Material=create_material_6)
custom_preview_7 = CustomPreview(Geometry=line_sdl_6, Material=create_material_7)

explode_3 = Explode(Curve=interpolate_3.Curve, Recursive=True)  # -> Segments, Vertices
evaluate_length_11 = EvaluateLength(Curve=explode_3.Segments, Length=0.5, Normalized=True)  # -> Point, Tangent, Parameter
curve_closest_point_3 = CurveClosestPoint(Point=evaluate_length_11.Point, Curve=curve)  # -> Point, Parameter, Distance
line_4 = Line(StartPoint=curve_closest_point_3.Point, EndPoint=evaluate_length_11.Point)

quick_graph_4 = QuickGraph(list_item_5, SortOrder=0)
create_material_8 = CreateMaterial(Diffuse=RGB(199, 199, 199), Specular=RGB(0, 255, 255), Emission=RGB(0, 0, 0), Transparency=0.5, Shine=100)
create_material_9 = CreateMaterial(Diffuse=RGB(224, 224, 224), Specular=RGB(0, 255, 255), Emission=RGB(0, 0, 0), Transparency=0.5, Shine=100)
line_sdl_7 = LineSDL(Start=evaluate_length_11.Point, Direction=line_4, Length=expr("ABS(X)", multiplication_8))  # disabled
evaluate_length_12 = EvaluateLength(Curve=line_sdl_7, Length=1, Normalized=True)  # -> Point, Tangent, Parameter
interpolate_4 = Interpolate(Vertices=evaluate_length_12.Point, Degree=1, Periodic=False, KnotStyle=2)  # -> Curve, Length, Domain
custom_preview_8 = CustomPreview(Geometry=interpolate_4.Curve, Material=create_material_8)
custom_preview_9 = CustomPreview(Geometry=line_sdl_7, Material=create_material_9)

explode_4 = Explode(Curve=interpolate_4.Curve, Recursive=True)  # -> Segments, Vertices
evaluate_length_13 = EvaluateLength(Curve=explode_4.Segments, Length=0.5, Normalized=True)  # -> Point, Tangent, Parameter
curve_closest_point_4 = CurveClosestPoint(Point=evaluate_length_13.Point, Curve=curve)  # -> Point, Parameter, Distance
line_5 = Line(StartPoint=curve_closest_point_4.Point, EndPoint=evaluate_length_13.Point)

quick_graph_5 = QuickGraph(list_item_6, SortOrder=0)
create_material_10 = CreateMaterial(Diffuse=RGB(191, 191, 191), Specular=RGB(0, 255, 255), Emission=RGB(0, 0, 0), Transparency=0.5, Shine=100)
create_material_11 = CreateMaterial(Diffuse=RGB(217, 217, 217), Specular=RGB(0, 255, 255), Emission=RGB(0, 0, 0), Transparency=0.5, Shine=100)
line_sdl_8 = LineSDL(Start=evaluate_length_13.Point, Direction=line_5, Length=expr("ABS(X)", multiplication_10))  # disabled
evaluate_length_14 = EvaluateLength(Curve=line_sdl_8, Length=1, Normalized=True)  # -> Point, Tangent, Parameter
interpolate_5 = Interpolate(Vertices=evaluate_length_14.Point, Degree=1, Periodic=False, KnotStyle=2)  # -> Curve, Length, Domain
custom_preview_10 = CustomPreview(Geometry=interpolate_5.Curve, Material=create_material_10)
custom_preview_11 = CustomPreview(Geometry=line_sdl_8, Material=create_material_11)

explode_5 = Explode(Curve=interpolate_5.Curve, Recursive=True)  # -> Segments, Vertices
evaluate_length_15 = EvaluateLength(Curve=explode_5.Segments, Length=0.5, Normalized=True)  # -> Point, Tangent, Parameter
curve_closest_point_5 = CurveClosestPoint(Point=evaluate_length_15.Point, Curve=curve)  # -> Point, Parameter, Distance
line_6 = Line(StartPoint=curve_closest_point_5.Point, EndPoint=evaluate_length_15.Point)

quick_graph_6 = QuickGraph(list_item_7, SortOrder=0)
create_material_12 = CreateMaterial(Diffuse=RGB(184, 184, 184), Specular=RGB(0, 255, 255), Emission=RGB(0, 0, 0), Transparency=0.5, Shine=100)
create_material_13 = CreateMaterial(Diffuse=RGB(209, 209, 209), Specular=RGB(0, 255, 255), Emission=RGB(0, 0, 0), Transparency=0.5, Shine=100)
line_sdl_9 = LineSDL(Start=evaluate_length_15.Point, Direction=line_6, Length=expr("ABS(X)", multiplication_12))
evaluate_length_16 = EvaluateLength(Curve=line_sdl_9, Length=1, Normalized=True)  # -> Point, Tangent, Parameter
interpolate_6 = Interpolate(Vertices=evaluate_length_16.Point, Degree=1, Periodic=False, KnotStyle=2)  # -> Curve, Length, Domain
custom_preview_12 = CustomPreview(Geometry=interpolate_6.Curve, Material=create_material_12)
custom_preview_13 = CustomPreview(Geometry=line_sdl_9, Material=create_material_13)

explode_6 = Explode(Curve=interpolate_6.Curve, Recursive=True)  # -> Segments, Vertices
evaluate_length_17 = EvaluateLength(Curve=explode_6.Segments, Length=0.5, Normalized=True)  # -> Point, Tangent, Parameter
curve_closest_point_6 = CurveClosestPoint(Point=evaluate_length_17.Point, Curve=curve)  # -> Point, Parameter, Distance
line_7 = Line(StartPoint=curve_closest_point_6.Point, EndPoint=evaluate_length_17.Point)

quick_graph_7 = QuickGraph(list_item_8, SortOrder=0)
create_material_14 = CreateMaterial(Diffuse=RGB(176, 176, 176), Specular=RGB(0, 255, 255), Emission=RGB(0, 0, 0), Transparency=0.5, Shine=100)
create_material_15 = CreateMaterial(Diffuse=RGB(201, 201, 201), Specular=RGB(0, 255, 255), Emission=RGB(0, 0, 0), Transparency=0.5, Shine=100)
line_sdl_10 = LineSDL(Start=evaluate_length_17.Point, Direction=line_7, Length=expr("ABS(X)", multiplication_14))  # disabled
evaluate_length_18 = EvaluateLength(Curve=line_sdl_10, Length=1, Normalized=True)  # -> Point, Tangent, Parameter
interpolate_7 = Interpolate(Vertices=evaluate_length_18.Point, Degree=1, Periodic=False, KnotStyle=2)  # -> Curve, Length, Domain
custom_preview_14 = CustomPreview(Geometry=interpolate_7.Curve, Material=create_material_14)
custom_preview_15 = CustomPreview(Geometry=line_sdl_10, Material=create_material_15)

explode_7 = Explode(Curve=interpolate_7.Curve, Recursive=True)  # -> Segments, Vertices
evaluate_length_19 = EvaluateLength(Curve=explode_7.Segments, Length=0.5, Normalized=True)  # -> Point, Tangent, Parameter
curve_closest_point_7 = CurveClosestPoint(Point=evaluate_length_19.Point, Curve=curve)  # -> Point, Parameter, Distance
line_8 = Line(StartPoint=curve_closest_point_7.Point, EndPoint=evaluate_length_19.Point)

quick_graph_8 = QuickGraph(list_item_9, SortOrder=0)
create_material_16 = CreateMaterial(Diffuse=RGB(176, 176, 176), Specular=RGB(0, 255, 255), Emission=RGB(0, 0, 0), Transparency=0.5, Shine=100)
create_material_17 = CreateMaterial(Diffuse=RGB(201, 201, 201), Specular=RGB(0, 255, 255), Emission=RGB(0, 0, 0), Transparency=0.5, Shine=100)
line_sdl_11 = LineSDL(Start=evaluate_length_19.Point, Direction=line_8, Length=expr("ABS(X)", multiplication_16))
evaluate_length_20 = EvaluateLength(Curve=line_sdl_11, Length=1, Normalized=True)  # -> Point, Tangent, Parameter
interpolate_8 = Interpolate(Vertices=evaluate_length_20.Point, Degree=1, Periodic=False, KnotStyle=2)  # -> Curve, Length, Domain
custom_preview_16 = CustomPreview(Geometry=interpolate_8.Curve, Material=create_material_16)
custom_preview_17 = CustomPreview(Geometry=line_sdl_11, Material=create_material_17)
