# Grasshopper definition XHꓨ. ⠀⠀ 𐄪 ⠀⠀ ▫◻▫☐▫◻▫⠀⠀  ⬜  ⠀⠀▫◻▫☐▫◻▫ ⠀⠀ 𐄪 ⠀⠀ .GHX (Grasshopper 1.0.7)
# plug-ins: Anemone, Pufferfish, GraphicPlus

rectangle = Rectangle(Plane=PlaneXY(0, 0, 0), XSize=Domain(-0.5, 0.5), YSize=Domain(-0.5, 0.5), Radius=0)  # -> Rectangle, Length
circle = Circle(Plane=PlaneXY(0, 0, 0), Radius=expr(".5/3^1", 0.5))
bounding_rectangle = BoundingRectangle(Geometry=circle, Plane=PlaneXY(0, 0, 0), Axis=0, Slide=0, Union=True)  # -> Bounding, DimensionX, DimensionY
circle_2 = Circle(Plane=PlaneXY(0, 0, 0), Radius=expr(".5", 0.5))
rebuild_curve = RebuildCurve(Curve=rectangle.Rectangle, Count=8, Degree=0, EndTangents=True)
series = Series(Start=224, Step=-32, Count=10)
curve_edit_points = CurveEditPoints(Curve=rebuild_curve, Knots=False)  # -> Points, Tangents, Parameters
scale = Scale(Geometry=flatten(bounding_rectangle.Bounding), Center=Point(0, 0, 0), Factor=expr("2^16", 1))  # -> Geometry, Transform
point = Point(Point(0, 0, 0))
cull_duplicates = CullDuplicates(Points=curve_edit_points.Points, Tolerance=7.629394531e-06, CullMode=1)  # -> Points, Indices, Valence
merge = Merge(Data1=point, Data2=cull_duplicates.Points)  # -> flatten(Result)
explode_tree = ExplodeTree(Data=graft(series))  # -> Branch0, Branch1, Branch2, Branch3, Branch4, Branch5, Branch6, Branch7, Branch8, Branch9
scale_2 = Scale(Geometry=flatten(circle), Center=Point(0, 0, 0), Factor=expr("2^16", 1))  # -> Geometry, Transform
scale_3 = Scale(Geometry=flatten(bounding_rectangle.Bounding), Center=Point(0, 0, 0), Factor=expr("2^16", 1))  # -> Geometry, Transform
scale_4 = Scale(Geometry=flatten(bounding_rectangle.Bounding), Center=Point(0, 0, 0), Factor=expr("2^16", 1))  # -> Geometry, Transform
scale_5 = Scale(Geometry=flatten(bounding_rectangle.Bounding), Center=Point(0, 0, 0), Factor=expr("2^16", 1))  # -> Geometry, Transform
scale_6 = Scale(Geometry=flatten(bounding_rectangle.Bounding), Center=Point(0, 0, 0), Factor=expr("2^16", 1))  # -> Geometry, Transform
scale_7 = Scale(Geometry=flatten(bounding_rectangle.Bounding), Center=Point(0, 0, 0), Factor=expr("2^16", 1))  # -> Geometry, Transform
scale_8 = Scale(Geometry=flatten(cull_duplicates.Points), Center=Point(0, 0, 0), Factor=expr("2^16", 1))  # -> flatten(Geometry), Transform
digit_scroller = DigitScroller(Scroller_Digits=12, Scroller_Prefix=" ", Scroller_Radix=11, Scroller_Value=2)
scale_9 = Scale(Geometry=flatten(cull_duplicates.Points), Center=Point(0, 0, 0), Factor=expr("2^16", 1))  # -> flatten(Geometry), Transform
boundary_surfaces = BoundarySurfaces(Edges=scale_2.Geometry)
fast_loop_start = FastLoopStart(Iterations=digit_scroller, Data=scale.Geometry)  # -> port, Counter, Data
digit_scroller_2 = DigitScroller(Scroller_Digits=12, Scroller_Prefix=" ", Scroller_Radix=11, Scroller_Value=0)
scale_10 = Scale(Geometry=flatten(cull_duplicates.Points), Center=Point(0, 0, 0), Factor=expr("2^16", 1))  # -> flatten(Geometry), Transform
digit_scroller_3 = DigitScroller(Scroller_Digits=12, Scroller_Prefix=" ", Scroller_Radix=11, Scroller_Value=4)
digit_scroller_4 = DigitScroller(Scroller_Digits=12, Scroller_Prefix=" ", Scroller_Radix=11, Scroller_Value=2)
digit_scroller_5 = DigitScroller(Scroller_Digits=12, Scroller_Prefix=" ", Scroller_Radix=11, Scroller_Value=1)
digit_scroller_6 = DigitScroller(Scroller_Digits=12, Scroller_Prefix=" ", Scroller_Radix=11, Scroller_Value=3)
scale_11 = Scale(Geometry=flatten(cull_duplicates.Points), Center=Point(0, 0, 0), Factor=expr("2^16", 1))  # -> flatten(Geometry), Transform
scale_12 = Scale(Geometry=flatten(cull_duplicates.Points), Center=Point(0, 0, 0), Factor=expr("2^16", 1))  # -> flatten(Geometry), Transform
scale_13 = Scale(Geometry=flatten(cull_duplicates.Points), Center=Point(0, 0, 0), Factor=expr("2^16", 1))  # -> flatten(Geometry), Transform
scale_14 = Scale(Geometry=flatten(cull_duplicates.Points), Center=Point(0, 0, 0), Factor=expr("2^16", 1))  # -> flatten(Geometry), Transform
fast_loop_start_2 = FastLoopStart(Iterations=digit_scroller_2, Data=scale_3.Geometry)  # -> port, Counter, Data
digit_scroller_7 = DigitScroller(Scroller_Digits=12, Scroller_Prefix=" ", Scroller_Radix=11, Scroller_Value=2)
fast_loop_start_3 = FastLoopStart(Iterations=expr("X-1", digit_scroller_7), Data=boundary_surfaces)  # -> port, Counter, Data
fast_loop_start_4 = FastLoopStart(Iterations=digit_scroller_3, Data=scale_4.Geometry)  # -> port, Counter, Data
fast_loop_start_5 = FastLoopStart(Iterations=digit_scroller_4, Data=scale_5.Geometry)  # -> port, Counter, Data
fast_loop_start_6 = FastLoopStart(Iterations=digit_scroller_5, Data=scale_6.Geometry)  # -> port, Counter, Data
fast_loop_start_7 = FastLoopStart(Iterations=digit_scroller_6, Data=scale_7.Geometry)  # -> port, Counter, Data
scale_15 = Scale(Geometry=flatten(merge), Center=Point(0, 0, 0), Factor=expr("2^16", 1))  # -> flatten(Geometry), Transform
fast_loop_start_8 = FastLoopStart(Iterations=expr("X-1", digit_scroller_7), Data=scale_2.Geometry)  # -> port, Counter, Data
fast_loop_start_9 = FastLoopStart(Iterations=digit_scroller_7, Data=scale_2.Geometry)  # -> port, Counter, Data
power = Power(A="3", B="-1")
scale_16 = Scale(Geometry=graft(fast_loop_start.Data), Center=scale_9.Geometry, Factor=power)  # -> Geometry, Transform
scale_17 = Scale(Geometry=graft(fast_loop_start_3.Data), Center=scale_8.Geometry, Factor=power)  # -> Geometry, Transform
scale_18 = Scale(Geometry=graft(fast_loop_start_2.Data), Center=scale_10.Geometry, Factor=power)  # -> Geometry, Transform
scale_19 = Scale(Geometry=graft(fast_loop_start_8.Data), Center=scale_8.Geometry, Factor=power)  # -> Geometry, Transform
scale_20 = Scale(Geometry=graft(fast_loop_start_4.Data), Center=scale_11.Geometry, Factor=power)  # -> Geometry, Transform
scale_21 = Scale(Geometry=graft(fast_loop_start_5.Data), Center=scale_12.Geometry, Factor=power)  # -> Geometry, Transform
scale_22 = Scale(Geometry=graft(fast_loop_start_6.Data), Center=scale_13.Geometry, Factor=power)  # -> Geometry, Transform
scale_23 = Scale(Geometry=graft(fast_loop_start_7.Data), Center=scale_14.Geometry, Factor=power)  # -> Geometry, Transform
fast_loop_end = FastLoopEnd(port=fast_loop_start.port, Exit=False, Data=scale_16.Geometry, RecordData=True, TimeOutVal=0)  # -> flatten(Data)
scale_24 = Scale(Geometry=graft(fast_loop_start_9.Data), Center=scale_15.Geometry, Factor=power)  # -> Geometry, Transform
fast_loop_end_2 = FastLoopEnd(port=fast_loop_start_2.port, Exit=False, Data=scale_18.Geometry, RecordData=False, TimeOutVal=0)  # -> flatten(Data)
fast_loop_end_3 = FastLoopEnd(port=fast_loop_start_8.port, Exit=False, Data=scale_19.Geometry, RecordData=True, TimeOutVal=0)
fast_loop_end_4 = FastLoopEnd(port=fast_loop_start_3.port, Exit=False, Data=scale_17.Geometry, RecordData=True, TimeOutVal=0)
fast_loop_end_5 = FastLoopEnd(port=fast_loop_start_4.port, Exit=False, Data=scale_20.Geometry, RecordData=False, TimeOutVal=0)  # -> flatten(Data)
fast_loop_end_6 = FastLoopEnd(port=fast_loop_start_5.port, Exit=False, Data=scale_21.Geometry, RecordData=False, TimeOutVal=0)  # -> flatten(Data)
fast_loop_end_7 = FastLoopEnd(port=fast_loop_start_6.port, Exit=False, Data=scale_22.Geometry, RecordData=False, TimeOutVal=0)  # -> flatten(Data)
fast_loop_end_8 = FastLoopEnd(port=fast_loop_start_7.port, Exit=False, Data=scale_23.Geometry, RecordData=False, TimeOutVal=0)  # -> flatten(Data)
merge_2 = Merge(Data1=scale.Geometry, Data2=fast_loop_end)  # -> flatten(Result)
merge_3 = Merge(Data1=boundary_surfaces, Data2=fast_loop_end_4)  # -> flatten(Result)
scale_25 = Scale(Geometry=flatten(merge_3), Center=Point(0, 0, 0), Factor=expr("1/2^16", 1))  # -> Geometry, Transform; disabled
fast_loop_end_9 = FastLoopEnd(port=fast_loop_start_9.port, Exit=False, Data=scale_24.Geometry, RecordData=True, TimeOutVal=0)  # -> flatten(Data)
merge_4 = Merge(Data1=scale_2.Geometry, Data2=fast_loop_end_3)  # -> flatten(Result)
scale_26 = Scale(Geometry=flatten(merge_2), Center=Point(0, 0, 0), Factor=expr("1/2^16", 1))  # -> Geometry, Transform
scale_27 = Scale(Geometry=flatten(fast_loop_end_2), Center=Point(0, 0, 0), Factor=expr("1/2^16", 1))  # -> Geometry, Transform
collision_one_many = CollisionOneMany(Collider=flatten(fast_loop_end_9), Obstacles=flatten(merge_3))  # -> Collision, Index
scale_28 = Scale(Geometry=flatten(scale_3.Geometry), Center=Point(0, 0, 0), Factor=expr("1/2^16", 1))  # -> Geometry, Transform
scale_29 = Scale(Geometry=flatten(fast_loop_end_5), Center=Point(0, 0, 0), Factor=expr("1/2^16", 1))  # -> Geometry, Transform
scale_30 = Scale(Geometry=flatten(fast_loop_end_6), Center=Point(0, 0, 0), Factor=expr("1/2^16", 1))  # -> Geometry, Transform
scale_31 = Scale(Geometry=flatten(fast_loop_end_7), Center=Point(0, 0, 0), Factor=expr("1/2^16", 1))  # -> Geometry, Transform
scale_32 = Scale(Geometry=flatten(fast_loop_end_8), Center=Point(0, 0, 0), Factor=expr("1/2^16", 1))  # -> Geometry, Transform
scale_33 = Scale(Geometry=flatten(merge_4), Center=Point(0, 0, 0), Factor=expr("1/2^16", 1))  # -> Geometry, Transform
digit_scroller_8 = DigitScroller(Scroller_Digits=12, Scroller_Prefix=" ", Scroller_Radix=11, Scroller_Value=212)
digit_scroller_9 = DigitScroller(Scroller_Digits=12, Scroller_Prefix=" ", Scroller_Radix=11, Scroller_Value=222)
digit_scroller_10 = DigitScroller(Scroller_Digits=12, Scroller_Prefix=" ", Scroller_Radix=11, Scroller_Value=206)
stroke = Stroke(ShapeGeometry=flatten(scale_29.Geometry), Color=RGBA(0, 0, 0, 0), Weight=0, EndCap=0)
digit_scroller_11 = DigitScroller(Scroller_Digits=12, Scroller_Prefix=" ", Scroller_Radix=11, Scroller_Value=200)
digit_scroller_12 = DigitScroller(Scroller_Digits=12, Scroller_Prefix=" ", Scroller_Radix=11, Scroller_Value=183)
cull_pattern = CullPattern(List=flatten(fast_loop_end_9), CullPattern=invert(flatten(collision_one_many.Collision)))
stroke_2 = Stroke(ShapeGeometry=flatten(scale_26.Geometry), Color=RGBA(0, 0, 0, 0), Weight=0, EndCap=0)
stroke_3 = Stroke(ShapeGeometry=flatten(scale_28.Geometry), Color=RGBA(0, 0, 0, 0), Weight=0, EndCap=0)
stroke_4 = Stroke(ShapeGeometry=flatten(scale_27.Geometry), Color=RGBA(0, 0, 0, 0), Weight=0, EndCap=0)
stroke_5 = Stroke(ShapeGeometry=flatten(scale_30.Geometry), Color=RGBA(0, 0, 0, 0), Weight=0, EndCap=0)
stroke_6 = Stroke(ShapeGeometry=flatten(scale_31.Geometry), Color=RGBA(0, 0, 0, 0), Weight=0, EndCap=0)
stroke_7 = Stroke(ShapeGeometry=flatten(scale_32.Geometry), Color=RGBA(0, 0, 0, 0), Weight=0, EndCap=0)
scale_34 = Scale(Geometry=flatten(cull_pattern), Center=Point(0, 0, 0), Factor=expr("1/2^16", 1))  # -> Geometry, Transform
colour_rgb = ColourRGB(Alpha=255, Red=digit_scroller_8, Green=digit_scroller_8, Blue=digit_scroller_8)
colour_rgb_2 = ColourRGB(Alpha=255, Red=digit_scroller_9, Green=digit_scroller_9, Blue=digit_scroller_9)
digit_scroller_13 = DigitScroller(Scroller_Digits=12, Scroller_Prefix=" ", Scroller_Radix=11, Scroller_Value=167)
colour_rgb_3 = ColourRGB(Alpha=255, Red=digit_scroller_13, Green=digit_scroller_13, Blue=digit_scroller_13)
solid_fill = SolidFill(ShapeGeometry=flatten(stroke), Color=colour_rgb_3)
colour_rgb_4 = ColourRGB(Alpha=255, Red=digit_scroller_10, Green=digit_scroller_10, Blue=digit_scroller_10)
colour_rgb_5 = ColourRGB(Alpha=255, Red=digit_scroller_11, Green=digit_scroller_11, Blue=digit_scroller_11)
colour_rgb_6 = ColourRGB(Alpha=255, Red=digit_scroller_12, Green=digit_scroller_12, Blue=digit_scroller_12)
solid_fill_2 = SolidFill(ShapeGeometry=flatten(stroke_2), Color=RGB(0, 244, 124))
solid_fill_3 = SolidFill(ShapeGeometry=flatten(stroke_3), Color=colour_rgb_2)
solid_fill_4 = SolidFill(ShapeGeometry=flatten(stroke_4), Color=colour_rgb)
solid_fill_5 = SolidFill(ShapeGeometry=flatten(stroke_5), Color=colour_rgb_5)
solid_fill_6 = SolidFill(ShapeGeometry=flatten(stroke_6), Color=colour_rgb_4)
solid_fill_7 = SolidFill(ShapeGeometry=flatten(stroke_7), Color=colour_rgb_6)
merge_5 = Merge(Data1=scale_33.Geometry, Data2=scale_34.Geometry)  # -> flatten(Result)
merge_6 = Merge(Data1=solid_fill, Data2=solid_fill_7, Data3=solid_fill_5, Data4=solid_fill_6, Data5=solid_fill_4, Data6=solid_fill_3)
merge_7 = Merge(Data1=solid_fill_3, Data2=solid_fill_4, Data3=solid_fill_6, Data4=solid_fill_5, Data5=solid_fill_7, Data6=solid_fill)
shape_preview_beta = ShapePreviewBeta(DrawingsShapesGeometry=solid_fill_2)  # disabled
shape_data = ShapeData(ShapeGeometry=solid_fill_2, ID=" ", Hover=False)
shape_data_2 = ShapeData(ShapeGeometry=merge_7, ID=" ", Hover=False)
rectangle_2pt = Rectangle2Pt(Plane=PlaneXY(0, 0, 0), PointA=Point(-0.5, -0.5, 0), PointB=Point(0.5, 0.5, 0), Radius=0)  # -> Rectangle, Length
shape_preview_beta_2 = ShapePreviewBeta(DrawingsShapesGeometry=solid_fill_3)  # disabled
stroke_8 = Stroke(ShapeGeometry=flatten(merge_5), Color=RGBA(0, 0, 0, 0), Weight=0, EndCap=2)
construct_drawing = ConstructDrawing(
    ShapesGeometry=flatten(shape_data),
    Boundary=rectangle_2pt.Rectangle,
    Width=1458,
    Height=1458,
    Color=RGBA(255, 255, 255, 0))  # -> Drawing, Boundary
drawing_viewer = DrawingViewer(DrawingsShapesGeometry=construct_drawing.Drawing, Resolution=96)
solid_fill_8 = SolidFill(ShapeGeometry=flatten(stroke_8), Color=RGB(0, 244, 124))
gradient_radial_fill = GradientRadialFill(ShapeGeometry=flatten(stroke_8), Colors=[RGB(0, 244, 124), RGBA(255, 255, 255, 0)], Parameters=[0, 1])
save_svg = SaveSvg(DrawingsShapesGeometry=construct_drawing.Drawing, FolderPath="C:\", FileName="ϱvƨ", Save=Button())
shape_preview_beta_3 = ShapePreviewBeta(DrawingsShapesGeometry=solid_fill_8)  # disabled
rectangle_2 = Rectangle(Plane=PlaneXY(0, 0, 0), XSize=Domain(-1, 1), YSize=Domain(-2, 2), Radius=0)  # -> Rectangle, Length
shape_data_3 = ShapeData(ShapeGeometry=solid_fill_8, ID=" ", Hover=False)
rectangle_2pt_2 = Rectangle2Pt(Plane=PlaneXY(0, 0, 0), PointA=Point(-0.5, -0.5, 0), PointB=Point(0.5, 0.5, 0), Radius=0)  # -> Rectangle, Length
construct_drawing_2 = ConstructDrawing(
    ShapesGeometry=flatten(shape_data_2),
    Boundary=rectangle_2pt_2.Rectangle,
    Width=1458,
    Height=1458,
    Color=RGBA(255, 255, 255, 0))  # -> Drawing, Boundary
drawing_viewer_2 = DrawingViewer(DrawingsShapesGeometry=construct_drawing_2.Drawing, Resolution=96)
save_svg_2 = SaveSvg(DrawingsShapesGeometry=construct_drawing_2.Drawing, FolderPath="C:\", FileName="ϱvƨ", Save=Button())
construct_drawing_3 = ConstructDrawing(
    ShapesGeometry=flatten(shape_data_3),
    Boundary=rectangle.Rectangle,
    Width=1458,
    Height=1458,
    Color=RGBA(255, 255, 255, 0))  # -> Drawing, Boundary
save_svg_3 = SaveSvg(DrawingsShapesGeometry=construct_drawing_3.Drawing, FolderPath="C:\", FileName="ϱvƨ", Save=Button())
drawing_viewer_3 = DrawingViewer(DrawingsShapesGeometry=construct_drawing_3.Drawing, Resolution=96)
