# Grasshopper definition XHꓨ.𖣠⚪ᗩ⚪ᑐᑕ⚪ꖴ⚪ᙁ⚪ߦ⚪ᗱᗴ⚪ᴥ⚪𖣓⚪ᙁ⚪ᗩ⚪ᗝ⚪Ⓞ⚪ИN⚪𖣓⚪ᗱᗴ⚪ᙁ⚪✤⚪ᴥ⚪ᑎ⚪✤⚪𖣓⚪ᗱᗴ⚪ᴥ⚪ᑎ⚪✤⚪ᗩ⚪ᗯ⚪ᴥ⚪ᑎ⚪ᑐᑕ⚪𔗢⚪𖡼⚪𔗢⚪𖡼⚪𔗢⚪𖡼⚪𔗢⚪𖡼⚪𔗢⚪🞋⚪𔗢⚪𖡼⚪𔗢⚪𖡼⚪𔗢⚪𖡼⚪𔗢⚪𖡼⚪𔗢⚪ᑐᑕ⚪ᑎ⚪ᴥ⚪ᗯ⚪ᗩ⚪✤⚪ᑎ⚪ᴥ⚪ᗱᗴ⚪𖣓⚪✤⚪ᑎ⚪ᴥ⚪✤⚪ᙁ⚪ᗱᗴ⚪𖣓⚪ИN⚪Ⓞ⚪ᗝ⚪ᗩ⚪ᙁ⚪𖣓⚪ᴥ⚪ᗱᗴ⚪ߦ⚪ᙁ⚪ꖴ⚪ᑐᑕ⚪ᗩ⚪𖣠.GHX (Grasshopper 1.0.7)
# plug-ins: Anemone

digit_scroller = DigitScroller(Scroller_Digits=12, Scroller_Prefix=" ", Scroller_Radix=1, Scroller_Value=0.03125)
digit_scroller_2 = DigitScroller(Scroller_Digits=12, Scroller_Prefix=" ", Scroller_Radix=1, Scroller_Value=0.125)
digit_scroller_3 = DigitScroller(Scroller_Digits=12, Scroller_Prefix=" ", Scroller_Radix=11, Scroller_Value=256)
fast_loop_start = FastLoopStart(Iterations=digit_scroller_3, Data=Point(0, 0, 0), Data_2=Vector(1, 0, 0))  # -> port, Counter, Data, Data_2
multiplication = Multiplication(A=fast_loop_start.Counter, B=digit_scroller_2)
rotate = Rotate(Vector=fast_loop_start.Data_2, Axis=Vector(0, 0, 1), Angle=degrees(multiplication))
line_sdl = LineSDL(Start=fast_loop_start.Data, Direction=rotate, Length=digit_scroller)
evaluate_length = EvaluateLength(Curve=line_sdl, Length=1, Normalized=True)  # -> Point, Tangent, Parameter
fast_loop_end = FastLoopEnd(
    port=fast_loop_start.port,
    Exit=False,
    Data=evaluate_length.Point,
    Data_2=evaluate_length.Tangent,
    RecordData=True,
    TimeOutVal=0)  # -> Data, Data_2
interpolate = Interpolate(Vertices=flatten(fast_loop_end.Data), Degree=3, Periodic=False, KnotStyle=2)  # -> flatten(Curve), Length, Domain
