# Grasshopper definition xhg.O-EREHPS-SELCRIC-LAIDAR-O-RADIAL-CIRCLES-SPHERE-O.ghx (Grasshopper 1.0.7)
# plug-ins: MeshEdit Components, Weaverbird

digit_scroller = DigitScroller(Scroller_Digits=12, Scroller_Prefix=" ", Scroller_Radix=4, Scroller_Value=16)
number_slider = Slider(1, range=0..1)
digit_scroller_2 = DigitScroller(Scroller_Digits=12, Scroller_Prefix=" ", Scroller_Radix=4, Scroller_Value=4)
digit_scroller_3 = DigitScroller(Scroller_Digits=12, Scroller_Prefix=" ", Scroller_Radix=11, Scroller_Value=0)
digit_scroller_4 = DigitScroller(Scroller_Digits=12, Scroller_Prefix=" ", Scroller_Radix=2, Scroller_Value=1)
point = Point(Point(0, 0, 0))

power = Power(A="2", B=Slider(4, range=0..8))
division = Division(A=power, B=Slider(4, range=0..16))

number = Number(power)
number_2 = Number(division)
number_3 = Number(digit_scroller_4)
point_2 = Point(point)
number_4 = Number(digit_scroller_3)
boolean = Boolean(Toggle(True))
boolean_2 = Boolean(Toggle(False))
boolean_3 = Boolean(Toggle(True))
boolean_4 = Boolean(Toggle(False))

polygon = Polygon(Plane=PlaneXY(0, 0, 0), Radius=number_3, Segments=number, FilletRadius=0)  # -> Polygon, Length
expression = Expression(O=number, Expression="(SIN((4*ATAN(1))/O)/(1+SIN((4*ATAN(1))/O)))")
series = Series(Start=1, Step=1, Count=expr("X-1", number_2))
circle = Circle(Plane=point_2, Radius=number_3)
end_points = EndPoints(Curve=circle)  # -> Start, End
subtraction = Subtraction(A=power, B=number_4)
division_2 = Division(A=power, B=subtraction)
division_3 = Division(A=number_3, B=number)
scale = Scale(Geometry=circle, Center=end_points.Start, Factor=expression)  # -> Geometry, Transform
area = Area(Geometry=circle)  # -> Area, Centroid
expression_2 = Expression(O=number, Expression="TAN(((4*ATAN(1))*(O-2))/(4*((O))))^2")
power_2 = Power(A=expression_2, B=series)
scale_2 = Scale(Geometry=scale.Geometry, Center=area.Centroid, Factor=power_2)  # -> Geometry, Transform
merge = Merge(Data1=scale.Geometry, Data2=scale_2.Geometry)
division_4 = Division(A=number, B=division_2)
division_5 = Division(A=number, B=division_2)
digit_scroller_5 = DigitScroller(Scroller_Digits=12, Scroller_Prefix=" ", Scroller_Radix=11, Scroller_Value=3)
number_5 = Number(expr(".5/65536*64", 1))
digit_scroller_6 = DigitScroller(Scroller_Digits=12, Scroller_Prefix=" ", Scroller_Radix=11, Scroller_Value=5)
power_of_2 = PowerOf2(Value=digit_scroller_6)
rectangle_2pt = Rectangle2Pt(Plane=PlaneXY(0, 0, 0), PointA=Point(1, -1, 0), PointB=Point(-1, 1, 0), Radius=0)  # -> Rectangle, Length
quad_sphere = QuadSphere(Base=PlaneXY(0, 0, 0), Radius=1)
deconstruct_brep = DeconstructBrep(Brep=quad_sphere)  # -> Faces, Edges, Vertices
list_item = ListItem(List=deconstruct_brep.Faces, Index=0, Wrap=True)

polar_array = PolarArray(Geometry=merge, Plane=point_2, Count=division_5, Angle=expr("360/X", degrees(division_2)))  # -> Geometry, Transform

stream_filter = StreamFilter(Gate=boolean, Stream1=polar_array.Geometry)

rotate = Rotate(Geometry=stream_filter, Angle=expr("180/X", degrees(number)), Plane=point_2)  # -> Geometry, Transform

stream_filter_2 = StreamFilter(Gate=boolean, Stream0=polar_array.Geometry, Stream1=rotate.Geometry)

expression_3 = Expression(O=number, Expression="COS(4*ATAN(1)/O)")
scale_3 = Scale(Geometry=stream_filter_2, Center=point_2, Factor=expression_3)  # -> Geometry, Transform

scale_4 = Scale(Geometry=polygon.Polygon, Center=point_2, Factor=expr("1/X", expression_3))  # -> Geometry, Transform
rotate_2 = Rotate(Geometry=scale_4.Geometry, Angle=expr("180/X", degrees(number)), Plane=point_2)  # -> Geometry, Transform
stream_filter_3 = StreamFilter(Gate=boolean_3, Stream1=rotate_2.Geometry)
explode = Explode(Curve=stream_filter_3, Recursive=True)  # -> Segments, Vertices
list_item_2 = ListItem(List=explode.Segments, Index=-1, Wrap=True)
scale_5 = Scale(Geometry=list_item_2, Center=area.Centroid, Factor=expression_2)  # -> Geometry, Transform
stream_filter_4 = StreamFilter(Gate=boolean_4, Stream0=scale_5.Geometry)
merge_2 = Merge(Data1=list_item_2, Data2=scale_5.Geometry)
stream_filter_5 = StreamFilter(Gate=boolean_4, Stream0=list_item_2)
flip_curve = FlipCurve(Curve=stream_filter_4)  # -> Curve, Flag
end_points_2 = EndPoints(Curve=merge_2)  # -> Start, End
stream_filter_6 = StreamFilter(Gate=boolean_4, Stream0=end_points_2.End)
stream_filter_7 = StreamFilter(Gate=boolean_4, Stream0=end_points_2.Start)
polyline = PolyLine(Vertices=stream_filter_7, Closed=False)
polyline_2 = PolyLine(Vertices=stream_filter_6, Closed=False)
flip_curve_2 = FlipCurve(Curve=polyline)  # -> Curve, Flag
discontinuity = Discontinuity(Curve=flip_curve_2.Curve, Level=1)  # -> Points, Parameters
merge_3 = Merge(Data1=stream_filter_5, Data2=polyline_2, Data3=flip_curve.Curve, Data4=flip_curve_2.Curve)
merge_4 = Merge(Data1=end_points_2.Start, Data2=reverse(end_points_2.End))  # -> reverse(Result)
stream_filter_8 = StreamFilter(Gate=boolean_4, Stream1=merge_4)
point_list = PointList(Points=discontinuity.Points, Size=division_3)
join_curves = JoinCurves(Curves=merge_3, Preserve=True)
point_list_2 = PointList(Points=merge_4, Size=division_3)
scale_6 = Scale(Geometry=join_curves, Center=point_2, Factor=power_2)  # -> Geometry, Transform
construct_mesh = ConstructMesh(Vertices=stream_filter_8, Faces={A=0, B=1, C=2, D=3})
scale_7 = Scale(Geometry=construct_mesh, Center=point_2, Factor=power_2)  # -> Geometry, Transform
merge_5 = Merge(Data1=construct_mesh, Data2=scale_7.Geometry)
merge_6 = Merge(Data1=join_curves, Data2=scale_6.Geometry)

polar_array_2 = PolarArray(Geometry=merge_6, Plane=point_2, Count=division_4, Angle=expr("360/X", degrees(division_2)))  # -> Geometry, Transform
polar_array_3 = PolarArray(Geometry=merge_5, Plane=point_2, Count=division_4, Angle=expr("360/X", degrees(division_2)))  # -> Geometry, Transform
mesh_join = MeshJoin(Meshes=flatten(polar_array_3.Geometry))

stream_filter_9 = StreamFilter(Gate=boolean_4, Stream0=polar_array_2.Geometry, Stream1=mesh_join)
stream_filter_10 = StreamFilter(Gate=boolean, Stream1=stream_filter_9)

rotate_3 = Rotate(Geometry=stream_filter_10, Angle=expr("180/X", degrees(number)), Plane=point_2)  # -> Geometry, Transform

stream_filter_11 = StreamFilter(Gate=boolean, Stream0=stream_filter_9, Stream1=rotate_3.Geometry)

scale_8 = Scale(Geometry=stream_filter_11, Center=point_2, Factor=expression_3)  # -> Geometry, Transform

stream_filter_12 = StreamFilter(Gate=boolean_2, Stream0=stream_filter_2, Stream1=scale_3.Geometry)
stream_filter_13 = StreamFilter(Gate=boolean_2, Stream0=stream_filter_11, Stream1=scale_8.Geometry)

rotate_4 = Rotate(Geometry=stream_filter_13, Angle=degrees(number_5), Plane=point_2)  # -> Geometry, Transform
rotate_5 = Rotate(Geometry=stream_filter_12, Angle=degrees(number_5), Plane=point_2)  # -> flatten(Geometry), Transform
discontinuity_2 = Discontinuity(Curve=rotate_4.Geometry, Level=1)  # -> Points, Parameters
area_2 = Area(Geometry=rotate_5.Geometry)  # -> Area, Centroid
divide_curve = DivideCurve(Curve=rotate_5.Geometry, Count=power_of_2, Kinks=True)  # -> Points, Tangents, Parameters
rotate_6 = Rotate(Geometry=divide_curve.Points, Angle=expr("180/X", degrees(power_of_2)), Plane=graft(area_2.Centroid))  # -> Geometry, Transform
stream_filter_14 = StreamFilter(Gate=Toggle(False), Stream0=rotate_6.Geometry, Stream1=discontinuity_2.Points)
deconstruct = Deconstruct(Point=stream_filter_14)  # -> XComponent, YComponent, ZComponent
stream_gate = StreamGate(Stream=deconstruct.XComponent, Gate=digit_scroller_5)  # -> Target0, Target1, Target2, Target3
stream_gate_2 = StreamGate(Stream=deconstruct.YComponent, Gate=digit_scroller_5)  # -> Target0, Target1, Target2, Target3

# ---- group: Circular_Lamé-based_Mapping_Inverse.cs
expression_4 = Expression(
    X=stream_gate.Target0,
    Y=stream_gate_2.Target0,
    Expression="((x/Sqrt(x^2+y^2))*Pow((abs(x)*(2/((1-abs(x))*(1-abs(y))))+abs(y)*(2/((1-abs(x))*(1-abs(y))))),(0.5*(1-abs(x))*(1-abs(y)))))")
expression_5 = Expression(
    X=stream_gate.Target0,
    Y=stream_gate_2.Target0,
    Expression="((y/Sqrt(x^2+y^2))*Pow((abs(x)*(2/((1-abs(x))*(1-abs(y))))+abs(y)*(2/((1-abs(x))*(1-abs(y))))),(0.5*(1-abs(x))*(1-abs(y)))))")

# ---- group: Circular_Tapered3_Mapping.cs
expression_6 = Expression(
    U=stream_gate.Target3,
    V=stream_gate_2.Target3,
    Expression="((((ABS(U)*ABS(V))/(U*V))/V)*SQRT((U^2+V^2-SQRT((U^2+V^2)*(U^2+V^2-2*U^2*V^2*(3-U^4-2*U^2*V^2-V^4))))/(3-U^4-2*U^2*V^2-V^4)))")
expression_7 = Expression(
    U=stream_gate.Target3,
    V=stream_gate_2.Target3,
    Expression="((((ABS(U)*ABS(V))/(U*V))/U)*SQRT((U^2+V^2-SQRT((U^2+V^2)*(U^2+V^2-2*U^2*V^2*(3-U^4-2*U^2*V^2-V^4))))/(3-U^4-2*U^2*V^2-V^4)))")

# ---- group: Circular_Area/Circular_Tapered3_Mapping_Inverse.cs
expression_8 = Expression(
    X=stream_gate.Target2,
    Y=stream_gate_2.Target2,
    Expression="((((ABS(X)*ABS(Y))/(X*Y))/(X*SQRT(X^2+Y^2)))*SQRT(1-SQRT(1-2*X^4*Y^2-2*X^2*Y^4+3*X^4*Y^4)))")
expression_9 = Expression(
    X=stream_gate.Target2,
    Y=stream_gate_2.Target2,
    Expression="((((ABS(X)*ABS(Y))/(X*Y))/(Y*SQRT(X^2+Y^2)))*SQRT(1-SQRT(1-2*X^4*Y^2-2*X^2*Y^4+3*X^4*Y^4)))")

# ---- group: Circular_Lamé-based_Mapping.cs
expression_10 = Expression(U=stream_gate.Target1, V=stream_gate_2.Target1, Expression="((abs(u) / u)*Pow(abs(u),(1-u^2-v^2)))")
expression_11 = Expression(U=stream_gate.Target1, V=stream_gate_2.Target1, Expression="((abs(v) / v)*Pow(abs(v),(1-u^2-v^2)))")

# ----
stream_filter_15 = StreamFilter(Gate=digit_scroller_5, Stream0=expression_4, Stream1=expression_10, Stream2=expression_9, Stream3=expression_6)
stream_filter_16 = StreamFilter(Gate=digit_scroller_5, Stream0=expression_5, Stream1=expression_11, Stream2=expression_8, Stream3=expression_7)
construct_point = ConstructPoint(XCoordinate=stream_filter_15, YCoordinate=stream_filter_16, ZCoordinate=0)
move = Move(Geometry=construct_point, Motion=Vector(0, 0, 1))  # -> Geometry, Transform
pull_point = PullPoint(Point=move.Geometry, Geometry=list_item, ClosestOnly=True)  # -> ClosestPoint, Distance
polyline_3 = PolyLine(Vertices=pull_point.ClosestPoint, Closed=True)
interpolate = Interpolate(Vertices=pull_point.ClosestPoint, Degree=1, Periodic=True, KnotStyle=2)  # -> Curve, Length, Domain
nurbs_curve = NurbsCurve(Vertices=pull_point.ClosestPoint, Degree=11, Periodic=True)  # -> Curve, Length, Domain; disabled
point_3 = Point(flatten(move.Geometry))
fragment_patch = FragmentPatch(Boundary=interpolate.Curve)
rotate_7 = Rotate(Geometry=fragment_patch, Angle=expr("-X", degrees(number_5)), Plane=point_2)  # -> Geometry, Transform
mirror = Mirror(Geometry=rotate_7.Geometry, Plane=PlaneXY(0, 0, 0))  # -> Geometry, Transform
merge_7 = Merge(Data1=rotate_7.Geometry, Data2=mirror.Geometry)
mirror_2 = Mirror(Geometry=merge_7, Plane=Plane(origin=(0, 0, 0), x=(-0.7071067812, 0, 0.7071067812), y=(0, -1, 0)))  # -> Geometry, Transform
mirror_3 = Mirror(Geometry=merge_7, Plane=Plane(origin=(0, 0, 0), x=(0, -0.7071067812, 0.7071067812), y=(1, 0, 0)))  # -> Geometry, Transform
patch = Patch(Curves=interpolate.Curve, Spans=2, Flexibility=1, Trim=True)  # disabled
discontinuity_3 = Discontinuity(Curve=rotate_7.Geometry, Level=1)  # -> Points, Parameters; disabled
merge_8 = Merge(Data1=merge_7, Data2=mirror_2.Geometry, Data3=mirror_3.Geometry)
sift_pattern = SiftPattern(List=discontinuity_3.Points, SiftPattern=[0, 1, 2, 3, 4])  # -> Output0, Output1, Output2, Output3, Output4; disabled
mesh_join_2 = MeshJoin(Meshes=flatten(merge_8))  # disabled
merge_9 = Merge(Data1=sift_pattern.Output0, Data2=sift_pattern.Output1, Data3=sift_pattern.Output2, Data4=sift_pattern.Output3)  # disabled
mesh_weldvertices = MeshWeldVertices(Mesh=mesh_join_2, Tolerance=0.0006506192)  # -> RuntimeMessage, Mesh; disabled
clean_tree = CleanTree(RemoveNulls=True, RemoveInvalid=True, RemoveEmpty=True, Tree=merge_9)  # disabled
construct_mesh_2 = ConstructMesh(Vertices=clean_tree, Faces={A=0, B=1, C=2, D=3})  # disabled
weaverbird_s_laplacian_smoothing = WeaverbirdsLaplacianSmoothing(MeshCurves=mesh_weldvertices.Mesh, Level=2048, SmoothNakedEdges=0, Thin=1)  # disabled
smooth_mesh = SmoothMesh(Mesh=mesh_weldvertices.Mesh, Strength=1, SkipNaked=True, Iterations=1024)  # disabled
deconstruct_mesh = DeconstructMesh(Mesh=smooth_mesh)  # -> Vertices, Faces, Colours, Normals; disabled
pull_point_2 = PullPoint(Point=deconstruct_mesh.Vertices, Geometry=quad_sphere, ClosestOnly=True)  # -> ClosestPoint, Distance; disabled
construct_mesh_3 = ConstructMesh(Vertices=pull_point_2.ClosestPoint, Faces=deconstruct_mesh.Faces)  # disabled
