# Grasshopper definition XHG.⚪✤⚪M⚪П⚪ƎE⚪◌⚪◌⚪ƎE⚪П⚪M⚪✤⚪.GHX (Grasshopper 1.0.7)
# plug-ins: MeshEdit Components, Weaverbird

digit_scroller = DigitScroller(Scroller_Digits=12, Scroller_Prefix=" ", Scroller_Radix=11, Scroller_Value=10)
digit_scroller_2 = DigitScroller(Scroller_Digits=12, Scroller_Prefix=" ", Scroller_Radix=11, Scroller_Value=17)
base = Base({Plane=PlaneXY(0, 0, 0), X=Domain(-1, 1), Y=Domain(-1, 1), Z=Domain(-1, 1)})
base_2 = Base({Plane=PlaneXY(0, 0, 0), X=Domain(-1, 1), Y=Domain(-1, 1), Z=Domain(-1, 1)})
mesh_plane = MeshPlane(Boundary=base, WidthCount=digit_scroller_2, HeightCount=digit_scroller_2)  # -> Mesh, Area
value_list = ValueList({"꞉": 0, "⋮": 1}, selected="꞉")
mesh_plane_2 = MeshPlane(Boundary=base_2, WidthCount=digit_scroller_2, HeightCount=digit_scroller_2)  # -> Mesh, Area
value_list_2 = ValueList({"꞉": 0, "⋮": 1, "⋮⋮": 2}, selected="⋮⋮")
mesh_box = MeshBox(Base=base, XCount=digit_scroller_2, YCount=digit_scroller_2, ZCount=digit_scroller_2)
mesh_box_2 = MeshBox(Base=base_2, XCount=digit_scroller_2, YCount=digit_scroller_2, ZCount=digit_scroller_2)
expression = Expression(Expression="1/(2*SQRT(2)+3)")
subtraction = Subtraction(A="1", B=expression)
division = Division(A=subtraction, B=2)
multiplication = Multiplication(A=division, B="100")
stream_filter = StreamFilter(Gate=value_list, Stream0=mesh_plane.Mesh, Stream1=mesh_plane.Mesh)
expression_2 = Expression(Expression="1/(SQRT(3)+2)")
deconstruct_mesh = DeconstructMesh(Mesh=stream_filter)  # -> Vertices, Faces, Colours, Normals
stream_filter_2 = StreamFilter(Gate=value_list, Stream0=expression, Stream1=expression_2, Stream2=expression_2)
value_list_3 = ValueList({"〇": 0, "·": 1}, selected="·")
value_list_4 = ValueList({"〇": 0, "·": 1}, selected="·")
deconstruct = Deconstruct(Point=deconstruct_mesh.Vertices)  # -> XComponent, YComponent, ZComponent
expression_3 = Expression(Expression="1/(2*SQRT(2)+3)")
expression_4 = Expression(Expression="1/(SQRT(3)+2)")
stream_gate = StreamGate(Stream=deconstruct.YComponent, Gate=value_list_3)  # -> Target0, Target1
bounds = Bounds(Numbers=stream_gate.Target1)
stream_gate_2 = StreamGate(Stream=deconstruct.ZComponent, Gate=value_list_3)  # -> Target0, Target1
stream_gate_3 = StreamGate(Stream=deconstruct.XComponent, Gate=value_list_3)  # -> Target0, Target1
remap_numbers = RemapNumbers(Value=stream_gate.Target1, Source=bounds, Target=Domain(1, 0))  # -> Mapped, Clipped
stream_filter_3 = StreamFilter(Gate=value_list_2, Stream0=expression_3, Stream1=expression_4, Stream2=expression_4)
division_2 = Division(A=stream_filter_2, B=2)
power = Power(A=stream_filter_2, B=remap_numbers.Mapped)
stream_filter_4 = StreamFilter(Gate=value_list_3, Stream0=stream_gate.Target0, Stream1=power)
multiplication_2 = Multiplication(A=stream_gate_3.Target1, B=power)
multiplication_3 = Multiplication(A=stream_gate_2.Target1, B=power)
subtraction_2 = Subtraction(A=".5", B=division_2)
stream_filter_5 = StreamFilter(Gate=value_list_3, Stream0=stream_gate_3.Target0, Stream1=multiplication_2)
stream_filter_6 = StreamFilter(Gate=value_list_3, Stream0=stream_gate_2.Target0, Stream1=multiplication_3)
construct_point = ConstructPoint(XCoordinate=stream_filter_5, YCoordinate=stream_filter_4, ZCoordinate=stream_filter_6)
division_3 = Division(A=subtraction_2, B=stream_filter_2)
construct_domain = ConstructDomain(DomainStart=0, DomainEnd=1)
division_4 = Division(A=stream_filter_2, B=".5")
multiplication_4 = Multiplication(A=digit_scroller_2, B=division_3)
construct_mesh = ConstructMesh(Vertices=construct_point, Faces=deconstruct_mesh.Faces)
point_list = PointList(Points=construct_point, Size=0.0625)
move = Move(Geometry=construct_mesh, Motion=Vector(0, 0, 1))  # -> Geometry, Transform
range = Range(Domain=Domain(-90, 90), Steps=1)
mesh_plane_3 = MeshPlane(
    Boundary={Plane=PlaneXZ(0, 0, 0), Size=Domain2(u=-1..1, v=-1..1)},
    WidthCount=digit_scroller_2,
    HeightCount=multiplication_4)  # -> Mesh, Area
range_2 = Range(Domain=Domain(0, 270), Steps=3)
vector_xyz = VectorXYZ(XComponent=0, YComponent=stream_filter_2, ZComponent=0)  # -> Vector, Length
xz_plane = XZPlane(Origin=Point(0, 0, 0))
move_2 = Move(Geometry=mesh_plane_3.Mesh, Motion=vector_xyz.Vector)  # -> Geometry, Transform
yz_plane = YZPlane(Origin=Point(0, 0, 0))
scale_nu = ScaleNU(Geometry=move_2.Geometry, Plane=PlaneXY(0, 0, 1), ScaleX=stream_filter_2, ScaleY=1, ScaleZ=subtraction_2)  # -> Geometry, Transform
stream_filter_7 = StreamFilter(Gate=value_list_3, Stream1=scale_nu.Geometry)
merge = Merge(Data1=move.Geometry, Data2=stream_filter_7)
polar_array = PolarArray(Geometry=merge, Plane=PlaneXY(0, 0, 0), Count=4, Angle=6.283185307)  # -> graft(Geometry), Transform
rotate = Rotate(Geometry=polar_array.Geometry, Angle=degrees(range_2), Plane=xz_plane)  # -> Geometry, Transform
rotate_2 = Rotate(Geometry=polar_array.Geometry, Angle=degrees(range), Plane=yz_plane)  # -> Geometry, Transform
merge_2 = Merge(Data1=rotate.Geometry, Data2=rotate_2.Geometry)  # -> flatten(Result)
mesh_join = MeshJoin(Meshes=merge_2)
mesh_weldvertices = MeshWeldVertices(Mesh=mesh_join, Tolerance=7.629394531e-06)  # -> RuntimeMessage, Mesh
natural_logarithm = NaturalLogarithm(Value=digit_scroller_2)
natural_logarithm_2 = NaturalLogarithm(Value="2")
division_5 = Division(A=natural_logarithm, B=natural_logarithm_2)
subtraction_3 = Subtraction(A=division_5, B=".4")
power_2 = Power(A="3.904", B=subtraction_3)
weaverbird_s_laplacian_smoothing = WeaverbirdsLaplacianSmoothing(MeshCurves=mesh_weldvertices.Mesh, Level=power_2, SmoothNakedEdges=1, Thin=0.5)
scale = Scale(Geometry=weaverbird_s_laplacian_smoothing, Center=Point(0, 0, 0), Factor=1)  # -> Geometry, Transform
stream_filter_8 = StreamFilter(Gate=value_list_2, Stream0=mesh_plane_2.Mesh, Stream1=mesh_box_2, Stream2=scale.Geometry)
deconstruct_mesh_2 = DeconstructMesh(Mesh=stream_filter_8)  # -> Vertices, Faces, Colours, Normals
deconstruct_2 = Deconstruct(Point=deconstruct_mesh_2.Vertices)  # -> XComponent, YComponent, ZComponent
stream_gate_4 = StreamGate(Stream=deconstruct_2.YComponent, Gate=value_list_4)  # -> Target0, Target1
stream_gate_5 = StreamGate(Stream=deconstruct_2.ZComponent, Gate=value_list_4)  # -> Target0, Target1
bounds_2 = Bounds(Numbers=stream_gate_4.Target1)
stream_gate_6 = StreamGate(Stream=deconstruct_2.XComponent, Gate=value_list_4)  # -> Target0, Target1
remap_numbers_2 = RemapNumbers(Value=stream_gate_4.Target1, Source=bounds_2, Target=Domain(1, 0))  # -> Mapped, Clipped
power_3 = Power(A=stream_filter_3, B=remap_numbers_2.Mapped)
stream_filter_9 = StreamFilter(Gate=value_list_4, Stream0=stream_gate_4.Target0, Stream1=power_3)
multiplication_5 = Multiplication(A=stream_gate_6.Target1, B=power_3)
multiplication_6 = Multiplication(A=stream_gate_5.Target1, B=power_3)
stream_filter_10 = StreamFilter(Gate=value_list_4, Stream0=stream_gate_6.Target0, Stream1=multiplication_5)
stream_filter_11 = StreamFilter(Gate=value_list_4, Stream0=stream_gate_5.Target0, Stream1=multiplication_6)
construct_point_2 = ConstructPoint(XCoordinate=stream_filter_10, YCoordinate=stream_filter_9, ZCoordinate=stream_filter_11)
point_list_2 = PointList(Points=construct_point_2, Size=0.0625)
construct_mesh_2 = ConstructMesh(Vertices=construct_point_2, Faces=deconstruct_mesh_2.Faces)
