# Grasshopper definition XHG..⠀⠀⠀⠀⊚⠀⠀⠀⠀ⵙᗱᗴⵙᙁⵙ✻ⵙᑐᑕⵙᗱᗴⵙߦⵙᔓᔕⵙ⠀⠀⠀⠀⊚⠀⠀⠀⠀ⵙᗝⵙꖴⵙⓄⵙᙏⵙᕤᕦⵙꖴⵙᔓᔕⵙ◯ⵙИNⵙⓄⵙꖴⵙ✤ⵙꖴⵙᔓᔕⵙИNⵙᗩⵙᴥⵙ✤ⵙ◯ⵙᙁⵙᗩⵙᗱᗴⵙᗝⵙꖴⵙ⠀⠀⠀⠀◯⠀⠀⠀⠀ⵙ⠀⠀⠀⠀◯⠀⠀⠀⠀ⵙꖴⵙᗝⵙᗱᗴⵙᗩⵙᙁⵙ◯ⵙ✤ⵙᴥⵙᗩⵙИNⵙᔓᔕⵙꖴⵙ✤ⵙꖴⵙⓄⵙИNⵙ◯ⵙᔓᔕⵙꖴⵙᕤᕦⵙᙏⵙⓄⵙꖴⵙᗝⵙ⠀⠀⠀⠀⊚⠀⠀⠀⠀ⵙᔓᔕⵙߦⵙᗱᗴⵙᑐᑕⵙ✻ⵙᙁⵙᗱᗴⵙ⠀⠀⠀⠀⊚⠀⠀⠀⠀..GHX (Grasshopper 1.0.7)
# plug-ins: Pancake, Wombat, CurvePlus, Kangaroo2 Components, Pufferfish, NGon, Yellow

arcsine = ArcSine(Value=0.5773502692)
geometry = Geometry(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)
geometry_2 = Geometry([Line((0, -0.2499798173, 0), (0, -0.2499798173, 0)), Line((0.005079224614, -0.253080913, 0), (0.00509585239, -0.2550339672, 0)), Line((0.01026330305, -0.2591918831, 0), (0.01026330305, -0.2591918831, 0)), Line((0.01547809486, -0.2623781712, 0), (0.01552797323, -0.2643306592, 0)), Line((0.02070199413, -0.264177528, 0), (0.02070199413, -0.264177528, 0)), Line((0.02607665906, -0.2687333476, 0), (0.02615976758, -0.2706847036, 0))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])
geometry_3 = Geometry(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)
geometry_4 = Geometry([Line((0, -0.2499798173, 0), (0, -0.2499798173, 0)), Line((0.005062596839, -0.2511278588, 0), (0.005079224614, -0.253080913, 0)), Line((0.01019679352, -0.2552861994, 0), (0.01026330305, -0.2591918831, 0)), Line((0.01542821648, -0.2604256832, 0), (0.01547809486, -0.2623781712, 0)), Line((0.02070199413, -0.264177528, 0), (0.02070199413, -0.264177528, 0)), Line((0.02599355053, -0.2667819916, 0), (0.02607665906, -0.2687333476, 0))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])
geometry_5 = Geometry(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)
geometry_6 = Geometry([Line((0, -0.2499798173, 0), (0, -0.2499798173, 0)), Line((0.005055790794, -0.2503284389, 0), (0.005062596839, -0.2511278588, 0)), Line((0.01013028399, -0.2513805157, 0), (0.01019679352, -0.2552861994, 0)), Line((0.01524911909, -0.2534149192, 0), (0.01542821648, -0.2604256832, 0)), Line((0.0204360062, -0.2563695573, 0), (0.02070199413, -0.264177528, 0)), Line((0.02569513422, -0.2597752923, 0), (0.02599355053, -0.2667819916, 0))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])
geometry_7 = Geometry(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)
geometry_8 = Geometry([Line((0, -0.2499798173, 0), (0, -0.2499798173, 0)), Line((0.005054235623, -0.2501457726, 0), (0.005055790794, -0.2503284389, 0)), Line((0.01011667222, -0.2505811828, 0), (0.01013028399, -0.2513805157, 0)), Line((0.01519609724, -0.2513393799, 0), (0.01524911909, -0.2534149192, 0)), Line((0.02030301224, -0.2524655719, 0), (0.0204360062, -0.2563695573, 0)), Line((0.02545104637, -0.2540442043, 0), (0.02569513422, -0.2597752923, 0))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])
geometry_9 = Geometry(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)
geometry_10 = Geometry([Line((0, -0.2499798173, 0), (0, -0.2499798173, 0)), Line((0.005053474017, -0.2500563165, 0), (0.005054235623, -0.2501457726, 0)), Line((0.01011045168, -0.2502158899, 0), (0.01011667222, -0.2505811828, 0)), Line((0.0151743303, -0.2504873133, 0), (0.01519609724, -0.2513393799, 0)), Line((0.02024857544, -0.2508676013, 0), (0.02030301224, -0.2524655719, 0)), Line((0.02533703771, -0.2513673251, 0), (0.02545104637, -0.2540442043, 0))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])
geometry_11 = Geometry(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)
geometry_12 = Geometry([Line((0, -0.2499798173, 0), (0, -0.2499798173, 0)), Line((0.005053095166, -0.2500118176, 0), (0.005053474017, -0.2500563165, 0)), Line((0.01010740533, -0.250036997, 0), (0.01011045168, -0.2502158899, 0)), Line((0.01516396109, -0.2500814109, 0), (0.0151743303, -0.2504873133, 0)), Line((0.02022369798, -0.2501373332, 0), (0.02024857544, -0.2508676013, 0)), Line((0.02528767082, -0.2502082096, 0), (0.02533703771, -0.2513673251, 0))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])
geometry_13 = Geometry(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)
geometry_14 = Geometry([Line((0, -0.2499798173, 0), (0, -0.2499798173, 0)), Line((0.00505290599, -0.2499895975, 0), (0.005053095166, -0.2500118176, 0)), Line((0.01010588996, -0.249948009, 0), (0.01010740533, -0.250036997, 0)), Line((0.01515883611, -0.2498807938, 0), (0.01516396109, -0.2500814109, 0)), Line((0.02021151488, -0.249779703, 0), (0.02022369798, -0.2501373332, 0)), Line((0.02526378758, -0.2496474403, 0), (0.02528767082, -0.2502082096, 0))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])
geometry_15 = Geometry(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)
geometry_16 = Geometry([Line((0, -0.2499798173, 0), (0, -0.2499798173, 0)), Line((0.005052811436, -0.2499784914, 0), (0.00505290599, -0.2499895975, 0)), Line((0.01010513328, -0.2499035736, 0), (0.01010588996, -0.249948009, 0)), Line((0.01515628107, -0.2497807767, 0), (0.01515883611, -0.2498807938, 0)), Line((0.02020545455, -0.2496018045, 0), (0.02021151488, -0.249779703, 0)), Line((0.02525194133, -0.249369295, 0), (0.02526378758, -0.2496474403, 0))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])
geometry_17 = Geometry(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)
geometry_18 = Geometry([Line((0, 0, 0), (0, -0.2499798173, 0)), Line((0.002924456143, 1.244862148e-05, 0), (0.005052811436, -0.2499784914, 0)), Line((0.005848700316, 4.979448592e-05, 0), (0.01010513328, -0.2499035736, 0)), Line((0.008772504511, 0.0001120339187, 0), (0.01515628107, -0.2497807767, 0)), Line((0.01169568364, 0.0001991612387, 0), (0.02020545455, -0.2496018045, 0)), Line((0.01461801525, 0.0003111671633, 0), (0.02525194133, -0.249369295, 0))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])
geometry_19 = Geometry(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)
divide_curve = DivideCurve(Curve=geometry_19, Count=512, Kinks=False)  # -> Points, Tangents, Parameters
list_item = ListItem(List=divide_curve.Points, Index=1, Wrap=False)
list_item_2 = ListItem(List=divide_curve.Points, Index=0, Wrap=False)
line = Line(StartPoint=list_item_2, EndPoint=list_item)
length = Length(Curve=line)  # -> expr("X/4", Length)
degrees = Degrees(Radians=arcsine)
yz_plane = YZPlane(Origin=Point(0, 0, 0))

geometry_20 = Geometry(geometry_19)
evaluate_length = EvaluateLength(Curve=geometry_20, Length=1, Normalized=True)  # -> Point, Tangent, Parameter
yz_plane_2 = YZPlane(Origin=evaluate_length.Point)
mirror = Mirror(Geometry=geometry_20, Plane=yz_plane_2)  # -> Geometry, Transform
geometry_21 = Geometry([geometry_20, mirror.Geometry])

geometry_22 = Geometry(geometry)
mirror_2 = Mirror(Geometry=geometry_22, Plane=yz_plane_2)  # -> Geometry, Transform
geometry_23 = Geometry([geometry_22, mirror_2.Geometry])

geometry_24 = Geometry(geometry_2)
mirror_3 = Mirror(Geometry=geometry_24, Plane=yz_plane_2)  # -> Geometry, Transform
geometry_25 = Geometry([geometry_24, mirror_3.Geometry])

geometry_26 = Geometry(geometry_3)
mirror_4 = Mirror(Geometry=geometry_26, Plane=yz_plane_2)  # -> Geometry, Transform
geometry_27 = Geometry([geometry_26, mirror_4.Geometry])

geometry_28 = Geometry(geometry_4)
mirror_5 = Mirror(Geometry=geometry_28, Plane=yz_plane_2)  # -> Geometry, Transform
geometry_29 = Geometry([geometry_28, mirror_5.Geometry])

geometry_30 = Geometry(geometry_5)
mirror_6 = Mirror(Geometry=geometry_30, Plane=yz_plane_2)  # -> Geometry, Transform
geometry_31 = Geometry([geometry_30, mirror_6.Geometry])

geometry_32 = Geometry(geometry_6)
mirror_7 = Mirror(Geometry=geometry_32, Plane=yz_plane_2)  # -> Geometry, Transform
geometry_33 = Geometry([geometry_32, mirror_7.Geometry])

geometry_34 = Geometry(geometry_7)
mirror_8 = Mirror(Geometry=geometry_34, Plane=yz_plane_2)  # -> Geometry, Transform
geometry_35 = Geometry([geometry_34, mirror_8.Geometry])

geometry_36 = Geometry(geometry_8)
mirror_9 = Mirror(Geometry=geometry_36, Plane=yz_plane_2)  # -> Geometry, Transform
geometry_37 = Geometry([geometry_36, mirror_9.Geometry])

geometry_38 = Geometry(geometry_9)
mirror_10 = Mirror(Geometry=geometry_38, Plane=yz_plane_2)  # -> Geometry, Transform
geometry_39 = Geometry([geometry_38, mirror_10.Geometry])

geometry_40 = Geometry(geometry_10)
mirror_11 = Mirror(Geometry=geometry_40, Plane=yz_plane_2)  # -> Geometry, Transform
geometry_41 = Geometry([geometry_40, mirror_11.Geometry])

geometry_42 = Geometry(geometry_11)
mirror_12 = Mirror(Geometry=geometry_42, Plane=yz_plane_2)  # -> Geometry, Transform
geometry_43 = Geometry([geometry_42, mirror_12.Geometry])

geometry_44 = Geometry(geometry_12)
mirror_13 = Mirror(Geometry=geometry_44, Plane=yz_plane_2)  # -> Geometry, Transform
geometry_45 = Geometry([geometry_44, mirror_13.Geometry])

geometry_46 = Geometry(geometry_13)
mirror_14 = Mirror(Geometry=geometry_46, Plane=yz_plane_2)  # -> Geometry, Transform
geometry_47 = Geometry([geometry_46, mirror_14.Geometry])

geometry_48 = Geometry(geometry_14)
mirror_15 = Mirror(Geometry=geometry_48, Plane=yz_plane_2)  # -> Geometry, Transform
geometry_49 = Geometry([geometry_48, mirror_15.Geometry])

geometry_50 = Geometry(geometry_15)
mirror_16 = Mirror(Geometry=geometry_50, Plane=yz_plane_2)  # -> Geometry, Transform
geometry_51 = Geometry([geometry_50, mirror_16.Geometry])

geometry_52 = Geometry(geometry_16)
mirror_17 = Mirror(Geometry=geometry_52, Plane=yz_plane_2)  # -> Geometry, Transform
geometry_53 = Geometry([geometry_52, mirror_17.Geometry])

geometry_54 = Geometry(geometry_17)
mirror_18 = Mirror(Geometry=geometry_54, Plane=yz_plane_2)  # -> Geometry, Transform
geometry_55 = Geometry([geometry_54, mirror_18.Geometry])

geometry_56 = Geometry(geometry_18)
mirror_19 = Mirror(Geometry=geometry_56, Plane=yz_plane_2)  # -> Geometry, Transform
geometry_57 = Geometry([geometry_56, mirror_19.Geometry])

merge = Merge(Data1=geometry_21, Data2=geometry_57)  # -> flatten(Result)
clean_tree = CleanTree(RemoveNulls=True, RemoveInvalid=True, RemoveEmpty=False, Tree=merge)
panel = Panel("https://speckle.xyz/streams/1a57412199/branches/%E2%A0%80%E2%A0%80%E2%A0%80%E2%A0%80%E2%B5%99%E1%97%9D%EA%96%B4%E2%93%9E%E1%99%8F%E1%95%A4%E1%95%A6%EA%96%B4%E1%94%93%E1%94%95%E2%B5%99%E1%B4%BB%E1%B4%BA%E2%93%9E%EA%96%B4%E2%9C%A4%EA%96%B4%E1%94%93%E1%94%95%E1%B4%BB%E1%B4%BA%E1%97%A9%E1%B4%A5%E2%9C%A4%E2%B5%99%E1%99%81%E1%97%A9%E1%97%B1%E1%97%B4%E1%97%9D%EA%96%B4%E2%B5%99%E2%A0%80%E2%A0%80%E2%A0%80%E2%A0%80%E2%97%AF%E2%A0%80%E2%A0%80%E2%A0%80%E2%A0%80%E2%B5%99%E2%A0%80%E2%A0%80%E2%A0%80%E2%A0%80%E2%97%AF%E2%A0%80%E2%A0%80%E2%A0%80%E2%A0%80%E2%B5%99%EA%96%B4%E1%97%9D%E1%97%B1%E1%97%B4%E1%97%A9%E1%99%81%E2%B5%99%E2%9C%A4%E1%B4%A5%E1%97%A9%E1%B4%BB%E1%B4%BA%E1%94%93%E1%94%95%EA%96%B4%E2%9C%A4%EA%96%B4%E2%93%9E%E1%B4%BB%E1%B4%BA%E2%B5%99%E1%94%93%E1%94%95%EA%96%B4%E1%95%A4%E1%95%A6%E1%99%8F%E2%93%9E%EA%96%B4%E1%97%9D%E2%B5%99%E2%A0%80%E2%A0%80%E2%A0%80%E2%A0%80")

colour_picker = ColourPicker(PickedColour=RGB(240, 240, 240))
create_material = CreateMaterial(Diffuse=colour_picker, Specular=RGB(255, 255, 255), Emission=RGB(0, 0, 0), Transparency=0, Shine=0)
custom_preview = CustomPreview(Geometry=geometry_53, Material=create_material)

colour_picker_2 = ColourPicker(PickedColour=RGB(161, 161, 161))
create_material_2 = CreateMaterial(Diffuse=colour_picker_2, Specular=RGB(255, 255, 255), Emission=RGB(0, 0, 0), Transparency=0, Shine=0)
custom_preview_2 = CustomPreview(Geometry=geometry_23, Material=create_material_2)

colour_picker_3 = ColourPicker(PickedColour=RGB(186, 186, 186))
create_material_3 = CreateMaterial(Diffuse=colour_picker_3, Specular=RGB(255, 255, 255), Emission=RGB(0, 0, 0), Transparency=0, Shine=0)
custom_preview_3 = CustomPreview(Geometry=geometry_25, Material=create_material_3)

colour_picker_4 = ColourPicker(PickedColour=RGB(168, 168, 168))
create_material_4 = CreateMaterial(Diffuse=colour_picker_4, Specular=RGB(255, 255, 255), Emission=RGB(0, 0, 0), Transparency=0, Shine=0)
custom_preview_4 = CustomPreview(Geometry=geometry_27, Material=create_material_4)

colour_picker_5 = ColourPicker(PickedColour=RGB(194, 194, 194))
create_material_5 = CreateMaterial(Diffuse=colour_picker_5, Specular=RGB(255, 255, 255), Emission=RGB(0, 0, 0), Transparency=0, Shine=0)
custom_preview_5 = CustomPreview(Geometry=geometry_29, Material=create_material_5)

colour_picker_6 = ColourPicker(PickedColour=RGB(176, 176, 176))
create_material_6 = CreateMaterial(Diffuse=colour_picker_6, Specular=RGB(255, 255, 255), Emission=RGB(0, 0, 0), Transparency=0, Shine=0)
custom_preview_6 = CustomPreview(Geometry=geometry_31, Material=create_material_6)

colour_picker_7 = ColourPicker(PickedColour=RGB(201, 201, 201))
create_material_7 = CreateMaterial(Diffuse=colour_picker_7, Specular=RGB(255, 255, 255), Emission=RGB(0, 0, 0), Transparency=0, Shine=0)
custom_preview_7 = CustomPreview(Geometry=geometry_33, Material=create_material_7)

colour_picker_8 = ColourPicker(PickedColour=RGB(184, 184, 184))
create_material_8 = CreateMaterial(Diffuse=colour_picker_8, Specular=RGB(255, 255, 255), Emission=RGB(0, 0, 0), Transparency=0, Shine=0)
custom_preview_8 = CustomPreview(Geometry=geometry_35, Material=create_material_8)

colour_picker_9 = ColourPicker(PickedColour=RGB(209, 209, 209))
create_material_9 = CreateMaterial(Diffuse=colour_picker_9, Specular=RGB(255, 255, 255), Emission=RGB(0, 0, 0), Transparency=0, Shine=0)
custom_preview_9 = CustomPreview(Geometry=geometry_37, Material=create_material_9)

colour_picker_10 = ColourPicker(PickedColour=RGB(191, 191, 191))
create_material_10 = CreateMaterial(Diffuse=colour_picker_10, Specular=RGB(255, 255, 255), Emission=RGB(0, 0, 0), Transparency=0, Shine=0)
custom_preview_10 = CustomPreview(Geometry=geometry_39, Material=create_material_10)

colour_picker_11 = ColourPicker(PickedColour=RGB(217, 217, 217))
create_material_11 = CreateMaterial(Diffuse=colour_picker_11, Specular=RGB(255, 255, 255), Emission=RGB(0, 0, 0), Transparency=0, Shine=0)
custom_preview_11 = CustomPreview(Geometry=geometry_41, Material=create_material_11)

colour_picker_12 = ColourPicker(PickedColour=RGB(199, 199, 199))
create_material_12 = CreateMaterial(Diffuse=colour_picker_12, Specular=RGB(255, 255, 255), Emission=RGB(0, 0, 0), Transparency=0, Shine=0)
custom_preview_12 = CustomPreview(Geometry=geometry_43, Material=create_material_12)

colour_picker_13 = ColourPicker(PickedColour=RGB(224, 224, 224))
create_material_13 = CreateMaterial(Diffuse=colour_picker_13, Specular=RGB(255, 255, 255), Emission=RGB(0, 0, 0), Transparency=0, Shine=0)
custom_preview_13 = CustomPreview(Geometry=geometry_45, Material=create_material_13)

colour_picker_14 = ColourPicker(PickedColour=RGB(207, 207, 207))
create_material_14 = CreateMaterial(Diffuse=colour_picker_14, Specular=RGB(255, 255, 255), Emission=RGB(0, 0, 0), Transparency=0, Shine=0)
custom_preview_14 = CustomPreview(Geometry=geometry_47, Material=create_material_14)

colour_picker_15 = ColourPicker(PickedColour=RGB(232, 232, 232))
create_material_15 = CreateMaterial(Diffuse=colour_picker_15, Specular=RGB(255, 255, 255), Emission=RGB(0, 0, 0), Transparency=0, Shine=0)
custom_preview_15 = CustomPreview(Geometry=geometry_49, Material=create_material_15)

colour_picker_16 = ColourPicker(PickedColour=RGB(214, 214, 214))
create_material_16 = CreateMaterial(Diffuse=colour_picker_16, Specular=RGB(255, 255, 255), Emission=RGB(0, 0, 0), Transparency=0, Shine=0)
custom_preview_16 = CustomPreview(Geometry=geometry_51, Material=create_material_16)

colour_picker_17 = ColourPicker(PickedColour=RGB(222, 222, 222))
create_material_17 = CreateMaterial(Diffuse=colour_picker_17, Specular=RGB(255, 255, 255), Emission=RGB(0, 0, 0), Transparency=0, Shine=0)
custom_preview_17 = CustomPreview(Geometry=geometry_55, Material=create_material_17)

colour_picker_18 = ColourPicker(PickedColour=RGB(247, 247, 247))
create_material_18 = CreateMaterial(Diffuse=colour_picker_18, Specular=RGB(255, 255, 255), Emission=RGB(0, 0, 0), Transparency=0, Shine=0)
custom_preview_18 = CustomPreview(Geometry=geometry_57, Material=create_material_18)

colour_picker_19 = ColourPicker(PickedColour=RGB(176, 176, 176))
create_material_19 = CreateMaterial(Diffuse=colour_picker_19, Specular=RGB(255, 255, 255), Emission=RGB(0, 0, 0), Transparency=0, Shine=0)
custom_preview_19 = CustomPreview(Geometry=geometry_21, Material=create_material_19)

merge_2 = Merge(
    Data1=geometry_21,
    Data2=geometry_57,
    Data3=geometry_55,
    Data4=geometry_53,
    Data5=geometry_51,
    Data6=geometry_49,
    Data7=geometry_47,
    Data8=geometry_45,
    Data9=geometry_43,
    Data10=geometry_41,
    Data11=geometry_39,
    Data12=geometry_37,
    Data13=geometry_35,
    Data14=geometry_33,
    Data15=geometry_31,
    Data16=geometry_29,
    Data17=geometry_27,
    Data18=geometry_25,
    Data19=geometry_23)  # -> flatten(Result)
clean_tree_2 = CleanTree(RemoveNulls=True, RemoveInvalid=True, RemoveEmpty=True, Tree=merge_2)
join_curves = JoinCurves(Curves=clean_tree_2, Preserve=True)
move = Move(Geometry=join_curves, Motion=Vector(-1, -0.5, 0))  # -> Geometry, Transform
rotate = Rotate(Geometry=move.Geometry, Angle=1.570796327, Plane=yz_plane)  # -> Geometry, Transform
rotate_2 = Rotate(Geometry=rotate.Geometry, Angle=arcsine, Plane=yz_plane)  # -> Geometry, Transform
rotate_3 = Rotate(Geometry=rotate_2.Geometry, Angle=degrees(-45), Plane=PlaneXY(0, 0, 0))  # -> Geometry, Transform
mesh_pipe = MeshPipe(Curve=rotate_3.Geometry, Radius=length, Segments=2, Accuracy=1, CapType=3, Faceted=True)  # -> flatten(Mesh)
deconstruct_mesh = DeconstructMesh(Mesh=mesh_pipe)  # -> Vertices, flatten(Faces), Colours, Normals
mesh_join = MeshJoin(Meshes=flatten(mesh_pipe))

number_slider = Slider(10, range=0..10)
construct_point = ConstructPoint(XCoordinate=0, YCoordinate=0, ZCoordinate=0)
division = Division(A=number_slider, B="3")
import_obj = ImportOBJ(
    File="C:\JBO.PIB.JBO.PIH.JBO.FUD.⠀⠀⠀⠀ⵙᗱᗴⵙᴥⵙᑎⵙ✤ⵙᔓᔕⵙᗱᗴⵙᕤᕦⵙ◯ⵙ❋ⵙ❋ⵙ❋ⵙ✤ⵙ⠀⠀⠀⠀◯⠀⠀⠀⠀ⵙ⠀⠀⠀⠀◯⠀⠀⠀⠀ⵙ✤ⵙ❋ⵙ❋ⵙ❋ⵙ◯ⵙᕤᕦⵙᗱᗴⵙᔓᔕⵙ✤ⵙᑎⵙᴥⵙᗱᗴⵙ⠀⠀⠀⠀.DUF.OBJ.HIP.OBJ.BIP.OBJ",
    MapYtoZ=True,
    LastSaveLocalization="neutral,N")
cone = Cone(Base=PlaneYZ(0, 0, 0), Radius=20, Length=80)  # -> Cone, Tip
ⵙ人ⵙᴥⵙ_ⵙᗱᗴⵙᙏⵙ_ⵙᗱᗴⵙᕤᕦⵙ_ⵙ_ⵙᕤᕦⵙᗱᗴⵙ_ⵙᙏⵙᗱᗴⵙ_ⵙᴥ = Slider(1, range=0..1)  # "ⵙ人ⵙᴥⵙ✤ⵙᗱᗴⵙᙏⵙⓄⵙᗱᗴⵙᕤᕦⵙ◯ⵙ◯ⵙᕤᕦⵙᗱᗴⵙⓄⵙᙏⵙᗱᗴⵙ✤ⵙᴥⵙ人ⵙ"
ⵙꕤⵙ_ⵙᴥⵙ_ⵙᴥⵙꖴⵙᙏⵙ_ⵙ_ⵙᙏⵙꖴⵙᴥⵙ_ⵙᴥⵙ_ⵙꕤⵙ = Slider(0, range=0..1)
ⵙꕤⵙ_ⵙ8ⵙ_ⵙᕤᕦⵙиnⵙꖴⵙᗝⵙиnⵙᑎⵙ_ⵙ8ⵙ_ⵙ_ⵙ8ⵙ_ⵙᑎⵙиn = Slider(0, range=0..1)  # "ⵙꕤⵙⓄⵙ8ⵙ◯ⵙᕤᕦⵙИNⵙꖴⵙᗝⵙИNⵙᑎⵙⓄⵙ8ⵙ◯ⵙ◯ⵙ8ⵙⓄⵙᑎⵙИNⵙᗝⵙꖴⵙИNⵙᕤᕦⵙ◯ⵙ8ⵙⓄⵙꕤ"
weldmesh = WeldMesh(Mesh=import_obj, Radius=1e-10, Align=False, Use_RTree=False)
division_2 = Division(A=number_slider, B="9")
multiplication = Multiplication(A=number_slider, B="sqrt(3)")
spiral = Spiral(
    BasePlane=Plane(origin=(0, 0, 0), x=(0, 1, 0), y=(-1, 0, 0)),
    Angle=31.41592654,
    Turns=division_2,
    BaseRadius=multiplication,
    PeakRadius=division)
pipe = Pipe(Curve=spiral, Radius=number_slider, Caps=2)
multipipe = MultiPipe(
    Curves=spiral,
    NodeSize=division_2,
    EndOffset=division,
    StrutSize=division_2,
    Segment=0,
    KinkAngle=0.6,
    CubeFit=0,
    Caps=1)
stream_filter = StreamFilter(Gate=Slider(1, range=0..1), Stream0=import_obj, Stream1=cone.Cone, Stream2=multipipe, Stream3=merge_2)
geometry_58 = Geometry(stream_filter)
bounding_box = BoundingBox(Content=geometry_58, Plane=PlaneXY(0, 0, 0), UnionBox=True)  # -> Box, Box_2
center_geometry_at_origin = CenterGeometryAtOrigin(Geometry=bounding_box.Box)  # -> RecenteredGeometry, TranslationVector
stream_filter_2 = StreamFilter(Gate=ⵙꕤⵙ_ⵙ8ⵙ_ⵙᕤᕦⵙиnⵙꖴⵙᗝⵙиnⵙᑎⵙ_ⵙ8ⵙ_ⵙ_ⵙ8ⵙ_ⵙᑎⵙиn, Stream1=bounding_box.Box)
stream_filter_3 = StreamFilter(Gate=ⵙ人ⵙᴥⵙ_ⵙᗱᗴⵙᙏⵙ_ⵙᗱᗴⵙᕤᕦⵙ_ⵙ_ⵙᕤᕦⵙᗱᗴⵙ_ⵙᙏⵙᗱᗴⵙ_ⵙᴥ, Stream1=geometry_58)
move_2 = Move(Geometry=[stream_filter_3, stream_filter_2], Motion=center_geometry_at_origin.TranslationVector)  # -> Geometry, Transform
export_file_to_path = ExportFileToPath(Run=Toggle(False), GeometryToExport=move_2.Geometry, ExportPath="C:\T888......OBJ")
bounding_box_2 = BoundingBox(Content=move_2.Geometry, Plane=PlaneXY(0, 0, 0), UnionBox=True)  # -> Box, Box_2
geometry_59 = Geometry(move_2.Geometry)
deconstruct_box = DeconstructBox(Box=bounding_box_2.Box)  # -> Plane, X, Y, Z
deconstruct_domain = DeconstructDomain(Domain=deconstruct_box.Y)  # -> Start, End
deconstruct_domain_2 = DeconstructDomain(Domain=deconstruct_box.Z)  # -> Start, End
deconstruct_domain_3 = DeconstructDomain(Domain=deconstruct_box.X)  # -> Start, End
multiplication_2 = Multiplication(A=deconstruct_domain_3.End, B="2")
line_2 = Line(Line((-299.7957001, 0, 0), (-299.7957001, -99.65670013, 0)))
line_3 = Line(Line((-99.65670013, 0, 0), (-99.65670013, -0.001, 0)))
geometry_60 = Geometry(<mesh referenced from the Rhino model>)
reduce_mesh = ReduceMesh(Mesh=geometry_60, FaceCount=0, Accuracy=10, FaceType=1, Distort=False, Normalize=False)  # -> Reduced, CountDifference
move_3 = Move(Geometry=reduce_mesh.Reduced, Motion=Vector(-457.5, 0, 238.875))  # -> Geometry, Transform
taper = Taper(
    Geometry=reduce_mesh.Reduced,
    Axis=Line((-299.7957001, 0, 0), (-99.65670013, 0, 0)),
    Start=line_2,
    End=line_3,
    Flat=False,
    Infinite=False,
    Rigid=False)
export_as = ExportAs(FileLocation="C:\5.OBJ", Overwrite=False, Export=True, CompMode=False, LastSaveLocalization="neutral,N")  # -> OK, ExportCommand
move_4 = Move(Geometry=taper, Motion=Vector(-199.3134003, 0, 0))  # -> Geometry, Transform
scale_nu = ScaleNU(Geometry=taper, Plane=PlaneXY(-1670.120177, 0, 0), ScaleX=0.7071067812, ScaleY=1, ScaleZ=1)  # -> Geometry, Transform

mesh_join_2 = MeshJoin(Meshes=import_obj)
yz_plane_3 = YZPlane(Origin=Point(0, 0, 0))
mirror_cut_mesh = MirrorCutMesh(
    Mesh=mesh_join_2,
    MirrorPlane=yz_plane_3,
    Reach=0,
    Offset=0,
    Flip=False,
    Join=False,
    Keep=False,
    ConnectionType=2,
    Bulge=0,
    Divisions=0,
    WeldVertices=0)  # -> MirrorCut, SplitIndex, ReachPlane, OffsetPlane, Intersected
mirror_20 = Mirror(Geometry=mirror_cut_mesh.MirrorCut, Plane=PlaneYZ(0, 0, 0))  # -> Geometry, Transform
mesh_join_3 = MeshJoin(Meshes=[mirror_20.Geometry, mirror_cut_mesh.MirrorCut])

multiplication_3 = Multiplication(A=deconstruct_domain_3.Start, B=3)
multiplication_4 = Multiplication(A=deconstruct_domain.Start, B="3")
addition = Addition(A=multiplication_3, B=multiplication_4)

multiplication_5 = Multiplication(A=deconstruct_domain_3.Start, B="6")
multiplication_6 = Multiplication(A=deconstruct_domain.Start, B="12")
addition_2 = Addition(A=multiplication_6, B=multiplication_5)
division_3 = Division(A=addition_2, B=2)
addition_3 = Addition(A=deconstruct_domain_2.Start, B=division_3)
vector_xyz = VectorXYZ(XComponent=multiplication_2, YComponent=addition, ZComponent=addition_3)  # -> Vector, Length
move_5 = Move(Geometry=geometry_59, Motion=vector_xyz.Vector)  # -> Geometry, Transform
mirror_21 = Mirror(Geometry=move_5.Geometry, Plane=PlaneYZ(0, 0, 0))  # -> Geometry, Transform

multiplication_7 = Multiplication(A=deconstruct_domain.Start, B="3")
addition_4 = Addition(A=deconstruct_domain_3.Start, B=multiplication_7)
addition_5 = Addition(A=addition_4, B=deconstruct_domain_2.Start)
addition_6 = Addition(A=multiplication_7, B=addition_5)

vector_xyz_2 = VectorXYZ(XComponent=0, YComponent=addition_4, ZComponent=addition_6)  # -> Vector, Length
move_6 = Move(Geometry=geometry_59, Motion=vector_xyz_2.Vector)  # -> Geometry, Transform

stream_filter_4 = StreamFilter(Gate=ⵙꕤⵙ_ⵙᴥⵙ_ⵙᴥⵙꖴⵙᙏⵙ_ⵙ_ⵙᙏⵙꖴⵙᴥⵙ_ⵙᴥⵙ_ⵙꕤⵙ, Stream0=move_6.Geometry, Stream1=[move_5.Geometry, mirror_21.Geometry])

polar_array = PolarArray(Geometry=stream_filter_4, Plane=PlaneXY(0, 0, 0), Count=4, Angle=6.283185307)  # -> Geometry, Transform
rotate_4 = Rotate(Geometry=polar_array.Geometry, Angle=1.570796327, Plane=PlaneYZ(0, 0, 0))  # -> Geometry, Transform
polar_array_2 = PolarArray(Geometry=polar_array.Geometry, Plane=Plane(origin=(0, 0, 0), x=(0, 0, 1), y=(1, 0, 0)), Count=4, Angle=6.283185307)  # -> Geometry, Transform
rotate_5 = Rotate(Geometry=polar_array.Geometry, Angle=1.570796327, Plane=Plane(origin=(0, 0, 0), x=(0, -1, 0), y=(0, 0, 1)))  # -> Geometry, Transform

weldmesh_2 = WeldMesh(Mesh=mesh_join_3, Radius=1e-10, Align=False, Use_RTree=False)
geometry_61 = Geometry(flatten([polar_array_2.Geometry, rotate_5.Geometry, rotate_4.Geometry]))
bounding_box_3 = BoundingBox(Content=geometry_61, Plane=PlaneXY(0, 0, 0), UnionBox=True)  # -> Box, Box_2
deconstruct_box_2 = DeconstructBox(Box=bounding_box_3.Box)  # -> Plane, X, Y, Z
panel_2 = Panel(deconstruct_box_2.X)
export_file_to_path_2 = ExportFileToPath(Run=Toggle(False), GeometryToExport=geometry_61, ExportPath="C:\24BB.OBJ")
