# Grasshopper definition XHG..⠀⠀⠀⠀ⵙ꞉ⵙ◯ⵙᗝⵙꖴⵙⓄⵙᙏⵙᕤᕦⵙꖴⵙᔓᔕⵙ◯ⵙИNⵙⓄⵙꖴⵙ✤ⵙꖴⵙᔓᔕⵙИNⵙᗩⵙᴥⵙ✤ⵙ◯ⵙꗳⵙᙁⵙᗱᗴⵙᔓᔕⵙ◯ⵙᙁⵙᗩⵙᗱᗴⵙᗝⵙꖴⵙ⠀⠀⠀⠀◯⠀⠀⠀⠀ⵙ⠀⠀⠀⠀◯⠀⠀⠀⠀ⵙꖴⵙᗝⵙᗱᗴⵙᗩⵙᙁⵙ◯ⵙᔓᔕⵙᗱᗴⵙᙁⵙꗳⵙ◯ⵙ✤ⵙᴥⵙᗩⵙИNⵙᔓᔕⵙꖴⵙ✤ⵙꖴⵙⓄⵙИNⵙ◯ⵙᔓᔕⵙꖴⵙᕤᕦⵙᙏⵙⓄⵙꖴⵙᗝⵙ◯ⵙ꞉ⵙ⠀⠀⠀⠀..GHX (Grasshopper 1.0.7)
# plug-ins: Heteroptera, Pufferfish

# ---- group: ⦿ᕤᕦ⦿ИN⦿⊙⦿ᙁ⦿ᗩ⦿ᑐᑕ⦿ᔓᔕ⦿ ◯ ⦿ᗱᗴ⦿ᴥ⦿ᕤᕦ⦿ᗱᗴ⦿ᗝ⦿ ⊚ ⦿◌⦿ ⊚ ⦿◌⦿ ◯ ⦿ ◯ ⦿◌⦿ ⊚ ⦿◌⦿ ⊚ ⦿ᗝ⦿ᗱᗴ⦿ᕤᕦ⦿ᴥ⦿ᗱᗴ⦿ ◯ ⦿ᔓᔕ⦿ᑐᑕ⦿ᗩ⦿ᙁ⦿⊙⦿ИN⦿ᕤᕦ⦿
digit_scroller = DigitScroller(Scroller_Digits=12, Scroller_Prefix=" ", Scroller_Radix=11, Scroller_Value=16)

# ---- group: ⦿ᕤᕦ⦿ИN⦿⊙⦿ᑫᑭ⦿ᗩ⦿ᙏ⦿ ◯ ⦿옷⦿ᑫᑭ⦿ᗩ⦿ᴥ⦿ᕤᕦ⦿ ◯ ⦿ᗱᗴ⦿ᴥ⦿Ⓞ⦿Θ⦿ᗱᗴ⦿8⦿ ◯ ⦿ᕤᕦ⦿ИN⦿⦿⦿ᙁ⦿ᗩ⦿ᑐᑕ⦿ᔓᔕ⦿ ◯ ⦿ᗱᗴ⦿ᗯ⦿ᴥ⦿ᑎ⦿ᑐᑕ⦿ ⊚ ⦿◌⦿ ⊚ ⦿◌⦿ ◯ ⦿ ◯ ⦿◌⦿ ⊚ ⦿◌⦿ ⊚ ⦿ᑐᑕ⦿ᑎ⦿ᴥ⦿ᗯ⦿ᗱᗴ⦿ ◯ ⦿ᔓᔕ⦿ᑐᑕ⦿ᗩ⦿ᙁ⦿⦿⦿ИN⦿ᕤᕦ⦿ ◯ ⦿8⦿ᗱᗴ⦿Θ⦿Ⓞ⦿ᴥ⦿ᗱᗴ⦿ ◯ ⦿ᕤᕦ⦿ᴥ⦿ᗩ⦿ᑫᑭ⦿옷⦿ ◯ ⦿ᙏ⦿ᗩ⦿ᑫᑭ⦿⊙⦿ИN⦿ᕤᕦ⦿
digit_scroller_2 = DigitScroller(Scroller_Digits=12, Scroller_Prefix=" ", Scroller_Radix=11, Scroller_Value=16)

# ---- group: ⦿人⦿✤⦿⊙⦿✤⦿ИN⦿ᗩ⦿ᑎ⦿¤⦿ ◯ ⦿✤⦿ИN⦿ᗱᗴ⦿ᙏ⦿ᕤᕦ⦿ᗱᗴ⦿ᔓᔕ⦿ ⊚ ⦿◌⦿ ⊚ ⦿◌⦿ ◯ ⦿ ◯ ⦿◌⦿ ⊚ ⦿◌⦿ ⊚ ⦿ᔓᔕ⦿ᗱᗴ⦿ᕤᕦ⦿ᙏ⦿ᗱᗴ⦿ИN⦿✤⦿ ◯ ⦿¤⦿ᑎ⦿ᗩ⦿ИN⦿✤⦿⊙⦿✤⦿人⦿
digit_scroller_3 = DigitScroller(Scroller_Digits=12, Scroller_Prefix=" ", Scroller_Radix=11, Scroller_Value=256)
number = Number(expr("X/2", digit_scroller_3))
number_2 = Number(expr("X*2", number))

# ---- group: ⦿ᕤᕦ⦿ИN⦿⊙⦿ᙁ⦿ᗩ⦿ᑐᑕ⦿ᔓᔕ⦿ ◯ ⦿옷⦿✤⦿ᕤᕦ⦿ИN⦿ᗱᗴ⦿ᙁ⦿ ◯ ⦿ᗱᗴ⦿ᗯ⦿ᴥ⦿ᑎ⦿ᑐᑕ⦿ ⊚ ⦿◌⦿ ⊚ ⦿◌⦿ ◯ ⦿ ◯ ⦿◌⦿ ⊚ ⦿◌⦿ ⊚ ⦿ᑐᑕ⦿ᑎ⦿ᴥ⦿ᗯ⦿ᗱᗴ⦿ ◯ ⦿ᙁ⦿ᗱᗴ⦿ИN⦿ᕤᕦ⦿✤⦿옷⦿ ◯ ⦿ᔓᔕ⦿ᑐᑕ⦿ᗩ⦿ᙁ⦿⊙⦿ИN⦿ᕤᕦ⦿
digit_scroller_4 = DigitScroller(Scroller_Digits=12, Scroller_Prefix=" ", Scroller_Radix=11, Scroller_Value=-1)

# ---- group: ⦿·⦿⊚⦿·⦿ ◯ ⦿Ⓞ⦿✤⦿ ◯ ⦿ᕤᕦ⦿ИN⦿⊙⦿ᙁ⦿ᗩ⦿ᑐᑕ⦿ᔓᔕ⦿ ◯ ⦿ᗱᗴ⦿ᗯ⦿ᴥ⦿ᑎ⦿ᑐᑕ⦿ ⊚ ⦿◌⦿ ⊚ ⦿◌⦿ ◯ ⦿ ◯ ⦿◌⦿ ⊚ ⦿◌⦿ ⊚ ⦿ᑐᑕ⦿ᑎ⦿ᴥ⦿ᗯ⦿ᗱᗴ⦿ ◯ ⦿ᔓᔕ⦿ᑐᑕ⦿ᗩ⦿ᙁ⦿⊙⦿ИN⦿ᕤᕦ⦿ ◯ ⦿✤⦿Ⓞ⦿ ◯ ⦿·⦿⊚⦿·⦿
boolean_toggle = BooleanToggle(False)

# ----
expression = Expression(X=number, O=digit_scroller_4, Expression="(X)^O")
duplicate_data = DuplicateData(Data=expression, Number=number, Order=True)
list_length = ListLength(List=duplicate_data)
series = Series(Start=0, Step=1, Count=list_length)
list_item = ListItem(List=duplicate_data, Index=series, Wrap=False)
panel = Panel(list_item)

expression_2 = Expression(X=number, O=digit_scroller_4, Expression="(X)^O")
duplicate_data_2 = DuplicateData(Data=expression_2, Number=number, Order=True)

list_length_2 = ListLength(List=duplicate_data_2)
series_2 = Series(Start=0, Step=1, Count=list_length_2)
list_item_2 = ListItem(List=duplicate_data_2, Index=series_2, Wrap=False)
panel_2 = Panel(list_item_2)

expression_3 = Expression(X=number, O=digit_scroller_4, Expression="(X)^O")
duplicate_data_3 = DuplicateData(Data=expression_3, Number=number, Order=True)

list_length_3 = ListLength(List=duplicate_data_3)
series_3 = Series(Start=0, Step=1, Count=list_length_3)
list_item_3 = ListItem(List=duplicate_data_3, Index=series_3, Wrap=False)
panel_3 = Panel(list_item_3)

expression_4 = Expression(X=number, O=digit_scroller_4, Expression="(X)^O")
duplicate_data_4 = DuplicateData(Data=expression_4, Number=number, Order=True)

list_length_4 = ListLength(List=duplicate_data_4)
series_4 = Series(Start=0, Step=1, Count=list_length_4)
list_item_4 = ListItem(List=duplicate_data_4, Index=series_4, Wrap=False)
panel_4 = Panel(list_item_4)

create_material = CreateMaterial(Diffuse=RGB(207, 207, 207), Specular=RGB(0, 255, 255), Emission=RGB(0, 0, 0), Transparency=0.5, Shine=100)  # disabled
create_material_2 = CreateMaterial(Diffuse=RGB(232, 232, 232), Specular=RGB(0, 255, 255), Emission=RGB(0, 0, 0), Transparency=0.5, Shine=100)  # disabled
derivatives = Derivatives()  # -> Point, FirstDerivative, SecondDerivative, ThirdDerivative, FourthDerivative, FifthDerivative, SixthDerivative; disabled
quick_graph = QuickGraph(derivatives.SixthDerivative, SortOrder=0)  # disabled
quick_graph_2 = QuickGraph(derivatives.FifthDerivative, SortOrder=0)  # disabled
quick_graph_3 = QuickGraph(derivatives.FourthDerivative, SortOrder=0)  # disabled
quick_graph_4 = QuickGraph(derivatives.ThirdDerivative, SortOrder=0)  # disabled
quick_graph_5 = QuickGraph(derivatives.SecondDerivative, SortOrder=0)  # disabled
quick_graph_6 = QuickGraph(derivatives.FirstDerivative, SortOrder=0)  # disabled
quick_graph_7 = QuickGraph(derivatives.Point, SortOrder=0)  # disabled
line_sdl = LineSDL(Direction=derivatives.ThirdDerivative, Length=expr("-X", 1))  # disabled
evaluate_length = EvaluateLength(Curve=line_sdl, Length=1, Normalized=True)  # -> Point, Tangent, Parameter; disabled
interpolate = Interpolate(Vertices=evaluate_length.Point, Degree=3, Periodic=False, KnotStyle=2)  # -> Curve, Length, Domain; disabled
custom_preview = CustomPreview(Geometry=interpolate.Curve, Material=create_material)  # disabled
custom_preview_2 = CustomPreview(Geometry=line_sdl, Material=create_material_2)  # disabled

# ---- group: ⦿ᑫᑭ⦿ᗱᗴ⦿✤⦿ᔓᔕ⦿ ◯ ⦿ᗱᗴ⦿ᴥ⦿ᕤᕦ⦿ᗱᗴ⦿ᗝ⦿ ⊚ ⦿◌⦿ ⊚ ⦿◌⦿ ◯ ⦿ ◯ ⦿◌⦿ ⊚ ⦿◌⦿ ⊚ ⦿ᗝ⦿ᗱᗴ⦿ᕤᕦ⦿ᴥ⦿ᗱᗴ⦿ ◯ ⦿ᔓᔕ⦿✤⦿ᗱᗴ⦿ᑫᑭ⦿
panel_5 = Panel("(0.12522392759152361+0.12522392759152368)/2/4/4")

# ----
radians = Radians(Degrees=panel_5)
series_5 = Series(Start=0, Step=radians, Count=expr("X+1", number))  # -> reverse(Series)
list_length_5 = ListLength(List=series_5)
series_6 = Series(Start=0, Step=1, Count=expr("X-1", list_length_5))
list_item_5 = ListItem(List=series_5, Index=series_6, Wrap=False)

panel_6 = Panel(list_item_5)

turtle = DotNETVBScriptLEGACY(Forward=list_item, Left=list_item_5)  # -> Output, Points; inputs Forward: list, Left: list
# ---------- turtle: VB ----------
    Dim i As Integer
    Dim dir As New On3dVector(1, 0, 0)
    Dim pos As New On3dVector(0, 0, 0)
    Dim axis As New On3dVector(0, 0, 1)
    Dim pnts As New List(Of On3dVector)

    pnts.Add(pos)

    For i = 0 To Forward.Count() - 1
      Dim P As New On3dVector
      dir.Rotate(Left(i), axis)
      P = dir * Forward(i) + pnts(i)
      pnts.Add(P)
    Next

    Points = pnts
# ---------- end turtle ----------
panel_7 = Panel(turtle.Points)
point = Point(turtle.Points)
interpolate_t = InterpolateT(Vertices=point, TangentStart=Vector(0, 0, 0), TangentEnd=Vector(0, 0, 0), KnotStyle=2)  # -> Curve, Length, Domain
curve = Curve(interpolate_t.Curve)
evaluate_length_2 = EvaluateLength(Curve=curve, Length=1, Normalized=True)  # -> Point, Tangent, Parameter
curve_2 = Curve(curve)
rotate = Rotate(Geometry=curve_2, Angle=3.141592654, Plane=evaluate_length_2.Point)  # -> Geometry, Transform
merge = Merge(Data1=curve_2, Data2=rotate.Geometry)
join_curves = JoinCurves(Curves=merge, Preserve=False)
evaluate_length_3 = EvaluateLength(Curve=join_curves, Length=1, Normalized=True)  # -> Point, Tangent, Parameter
deconstruct = Deconstruct(Point=evaluate_length_3.Point)  # -> XComponent, YComponent, ZComponent
scale_nu = ScaleNU(
    Geometry=join_curves,
    Plane=PlaneXY(0, 0, 0),
    ScaleX=expr("1/X", deconstruct.XComponent),
    ScaleY=expr("1/X", deconstruct.YComponent),
    ScaleZ=1)  # -> Geometry, Transform
division = Division(A=deconstruct.XComponent, B=deconstruct.YComponent)
format = Format(Format="{0:R}", Culture=127, Data0=division)
panel_8 = Panel(format)
scaled = StreamFilter(Gate=boolean_toggle, Stream0=join_curves, Stream1=scale_nu.Geometry)
curve_3 = Curve(scaled)

radians_2 = Radians(Degrees=panel_5)
series_7 = Series(Start=0, Step=radians_2, Count=expr("X+1", number))  # -> reverse(Series)
list_length_6 = ListLength(List=series_7)
series_8 = Series(Start=0, Step=1, Count=expr("X-1", list_length_6))
list_item_6 = ListItem(List=series_7, Index=series_8, Wrap=False)

curve_4 = Curve(curve_3)

radians_3 = Radians(Degrees=panel_5)
series_9 = Series(Start=0, Step=radians_3, Count=expr("X+1", number))  # -> reverse(Series)
list_length_7 = ListLength(List=series_9)
series_10 = Series(Start=0, Step=1, Count=expr("X-1", list_length_7))
list_item_7 = ListItem(List=series_9, Index=series_10, Wrap=False)

radians_4 = Radians(Degrees=panel_5)
series_11 = Series(Start=0, Step=radians_4, Count=expr("X+1", number))  # -> reverse(Series)
list_length_8 = ListLength(List=series_11)
series_12 = Series(Start=0, Step=1, Count=expr("X-1", list_length_8))
list_item_8 = ListItem(List=series_11, Index=series_12, Wrap=False)

digit_scroller_5 = DigitScroller(Scroller_Digits=12, Scroller_Prefix="Digit Scroller", Scroller_Radix=5, Scroller_Value=9817.028383)

digit_scroller_6 = DigitScroller(Scroller_Digits=12, Scroller_Prefix="Digit Scroller", Scroller_Radix=4, Scroller_Value=532.5234381)

digit_scroller_7 = DigitScroller(Scroller_Digits=12, Scroller_Prefix="Digit Scroller", Scroller_Radix=4, Scroller_Value=34.08106675)
line_sdl_2 = LineSDL(Start=Point(-2.121093912, 1.99985794, 0), Direction=Vector(0.0625, 0.0625, 0), Length=1)

digit_scroller_8 = DigitScroller(Scroller_Digits=12, Scroller_Prefix="Digit Scroller", Scroller_Radix=6, Scroller_Value=383463.9766)  # disabled

digit_scroller_9 = DigitScroller(Scroller_Digits=12, Scroller_Prefix="Digit Scroller", Scroller_Radix=3, Scroller_Value=1.892015)

digit_scroller_10 = DigitScroller(Scroller_Digits=12, Scroller_Prefix="Digit Scroller", Scroller_Radix=5, Scroller_Value=56336.19681)  # disabled

digit_scroller_11 = DigitScroller(Scroller_Digits=12, Scroller_Prefix="Digit Scroller", Scroller_Radix=6, Scroller_Value=271915.0063)  # disabled

digit_scroller_12 = DigitScroller(Scroller_Digits=12, Scroller_Prefix="Digit Scroller", Scroller_Radix=7, Scroller_Value=2183007.899)  # disabled

digit_scroller_13 = DigitScroller(Scroller_Digits=12, Scroller_Prefix="Digit Scroller", Scroller_Radix=3, Scroller_Value=0.0689)
line_sdl_3 = LineSDL(Start=Point(0, 0, 0), Direction=Vector(1, 0, 0), Length=1)

create_material_3 = CreateMaterial(Diffuse=RGB(191, 191, 191), Specular=RGB(0, 255, 255), Emission=RGB(0, 0, 0), Transparency=0.5, Shine=100)

create_material_4 = CreateMaterial(Diffuse=RGB(217, 217, 217), Specular=RGB(0, 255, 255), Emission=RGB(0, 0, 0), Transparency=0.5, Shine=100)

create_material_5 = CreateMaterial(Diffuse=RGB(199, 199, 199), Specular=RGB(0, 255, 255), Emission=RGB(0, 0, 0), Transparency=0.5, Shine=100)

create_material_6 = CreateMaterial(Diffuse=RGB(224, 224, 224), Specular=RGB(0, 255, 255), Emission=RGB(0, 0, 0), Transparency=0.5, Shine=100)

create_material_7 = CreateMaterial(Diffuse=RGB(207, 207, 207), Specular=RGB(0, 255, 255), Emission=RGB(0, 0, 0), Transparency=0.5, Shine=100)

create_material_8 = CreateMaterial(Diffuse=RGB(232, 232, 232), Specular=RGB(0, 255, 255), Emission=RGB(0, 0, 0), Transparency=0.5, Shine=100)

create_material_9 = CreateMaterial(Diffuse=RGB(214, 214, 214), Specular=RGB(0, 255, 255), Emission=RGB(0, 0, 0), Transparency=0.5, Shine=100)

create_material_10 = CreateMaterial(Diffuse=RGB(240, 240, 240), Specular=RGB(0, 255, 255), Emission=RGB(0, 0, 0), Transparency=0.5, Shine=100)

create_material_11 = CreateMaterial(Diffuse=RGB(161, 161, 161), Specular=RGB(0, 255, 255), Emission=RGB(0, 0, 0), Transparency=0.5, Shine=100)  # disabled

create_material_12 = CreateMaterial(Diffuse=RGB(186, 186, 186), Specular=RGB(0, 255, 255), Emission=RGB(0, 0, 0), Transparency=0.5, Shine=100)  # disabled

create_material_13 = CreateMaterial(Diffuse=RGB(168, 168, 168), Specular=RGB(0, 255, 255), Emission=RGB(0, 0, 0), Transparency=0.5, Shine=100)  # disabled

create_material_14 = CreateMaterial(Diffuse=RGB(194, 194, 194), Specular=RGB(0, 255, 255), Emission=RGB(0, 0, 0), Transparency=0.5, Shine=100)  # disabled

create_material_15 = CreateMaterial(Diffuse=RGB(184, 184, 184), Specular=RGB(0, 255, 255), Emission=RGB(0, 0, 0), Transparency=0.5, Shine=100)  # disabled

create_material_16 = CreateMaterial(Diffuse=RGB(209, 209, 209), Specular=RGB(0, 255, 255), Emission=RGB(0, 0, 0), Transparency=0.5, Shine=100)  # disabled

create_material_17 = CreateMaterial(Diffuse=RGB(176, 176, 176), Specular=RGB(0, 255, 255), Emission=RGB(0, 0, 0), Transparency=0.5, Shine=100)  # disabled

create_material_18 = CreateMaterial(Diffuse=RGB(201, 201, 201), Specular=RGB(0, 255, 255), Emission=RGB(0, 0, 0), Transparency=0.5, Shine=100)  # disabled

create_material_19 = CreateMaterial(Diffuse=RGB(222, 222, 222), Specular=RGB(0, 255, 255), Emission=RGB(0, 0, 0), Transparency=0.5, Shine=100)

create_material_20 = CreateMaterial(Diffuse=RGB(247, 247, 247), Specular=RGB(0, 255, 255), Emission=RGB(0, 0, 0), Transparency=0.5, Shine=100)

scale = Scale(Geometry=curve_4, Center=Point(0, 0, 0), Factor=expr("2^X", digit_scroller_2))  # -> Geometry, Transform
degrees = Degrees(Radians=list_item_6)
power = Power(A=2, B=digit_scroller)
one_over_x = OneOverX(Value=power)
power_2 = Power(A=2, B=digit_scroller)
multiplication = Multiplication(A=degrees, B=power_2)

bounds = Bounds(Numbers=multiplication)
curve_5 = Curve(scale.Geometry)
end_points = EndPoints(Curve=curve_5)  # -> Start, End
rectangle_2pt = Rectangle2Pt(Plane=PlaneXY(0, 0, 0), PointA=end_points.Start, PointB=end_points.End, Radius=0)  # -> Rectangle, Length
graphmapper = GraphMapper(Curve=curve_5, Boundary=rectangle_2pt.Rectangle, Numbers=multiplication, Input=bounds, Output=bounds)

multiplication_2 = Multiplication(A=graphmapper, B=one_over_x)
radians_5 = Radians(Degrees=multiplication_2)
panel_10 = Panel(radians_5)

turtle_2 = DotNETVBScriptLEGACY(Forward=list_item_2, Left=radians_5)  # -> Output, Points; inputs Forward: list, Left: list; same code as turtle
panel_11 = Panel(turtle_2.Points)
point_2 = Point(turtle_2.Points)
interpolate_t_2 = InterpolateT(Vertices=point_2, TangentStart=Vector(0, 0, 0), TangentEnd=Vector(0, 0, 0), KnotStyle=2)  # -> Curve, Length, Domain
curve_6 = Curve(interpolate_t_2.Curve)
evaluate_length_4 = EvaluateLength(Curve=curve_6, Length=1, Normalized=True)  # -> Point, Tangent, Parameter
curve_7 = Curve(curve_6)
rotate_2 = Rotate(Geometry=curve_7, Angle=3.141592654, Plane=evaluate_length_4.Point)  # -> Geometry, Transform
merge_2 = Merge(Data1=curve_7, Data2=rotate_2.Geometry)
join_curves_2 = JoinCurves(Curves=merge_2, Preserve=False)
evaluate_length_5 = EvaluateLength(Curve=join_curves_2, Length=1, Normalized=True)  # -> Point, Tangent, Parameter
deconstruct_2 = Deconstruct(Point=evaluate_length_5.Point)  # -> XComponent, YComponent, ZComponent
scale_nu_2 = ScaleNU(
    Geometry=join_curves_2,
    Plane=PlaneXY(0, 0, 0),
    ScaleX=expr("1/X", deconstruct_2.XComponent),
    ScaleY=expr("1/X", deconstruct_2.YComponent),
    ScaleZ=1)  # -> Geometry, Transform
division_2 = Division(A=deconstruct_2.XComponent, B=deconstruct_2.YComponent)
format_2 = Format(Format="{0:R}", Culture=127, Data0=division_2)
panel_12 = Panel(format_2)
scaled_2 = StreamFilter(Gate=boolean_toggle, Stream0=join_curves_2, Stream1=scale_nu_2.Geometry)
curve_8 = Curve(scaled_2)

curve_9 = Curve(curve_8)

digit_scroller_14 = DigitScroller(Scroller_Digits=12, Scroller_Prefix=" ", Scroller_Radix=2, Scroller_Value=0.0833333333)

digit_scroller_15 = DigitScroller(Scroller_Digits=12, Scroller_Prefix=" ", Scroller_Radix=1, Scroller_Value=0.43075)

digit_scroller_16 = DigitScroller(Scroller_Digits=12, Scroller_Prefix=" ", Scroller_Radix=11, Scroller_Value=256)
digit_scroller_17 = DigitScroller(Scroller_Digits=12, Scroller_Prefix=" ", Scroller_Radix=11, Scroller_Value=87)
digit_scroller_18 = DigitScroller(Scroller_Digits=12, Scroller_Prefix=" ", Scroller_Radix=1, Scroller_Value=0.12025)
create_material_21 = CreateMaterial(Diffuse=RGB(222, 222, 222), Specular=RGB(0, 255, 255), Emission=RGB(0, 0, 0), Transparency=0.5, Shine=100)
create_material_22 = CreateMaterial(Diffuse=RGB(247, 247, 247), Specular=RGB(0, 255, 255), Emission=RGB(0, 0, 0), Transparency=0.5, Shine=100)
create_material_23 = CreateMaterial(Diffuse=RGB(176, 176, 176), Specular=RGB(0, 255, 255), Emission=RGB(0, 0, 0), Transparency=0.5, Shine=100)

digit_scroller_19 = DigitScroller(Scroller_Digits=12, Scroller_Prefix=" ", Scroller_Radix=3, Scroller_Value=0.166666666)

digit_scroller_20 = DigitScroller(Scroller_Digits=12, Scroller_Prefix=" ", Scroller_Radix=3, Scroller_Value=1000)

digit_scroller_21 = DigitScroller(Scroller_Digits=12, Scroller_Prefix=" ", Scroller_Radix=2, Scroller_Value=2.61)

digit_scroller_22 = DigitScroller(Scroller_Digits=12, Scroller_Prefix=" ", Scroller_Radix=1, Scroller_Value=0.07425)

digit_scroller_23 = DigitScroller(Scroller_Digits=12, Scroller_Prefix=" ", Scroller_Radix=1, Scroller_Value=0.07125)

create_material_24 = CreateMaterial(Diffuse=RGB(176, 176, 176), Specular=RGB(0, 255, 255), Emission=RGB(0, 0, 0), Transparency=0.5, Shine=100)
create_material_25 = CreateMaterial(Diffuse=RGB(201, 201, 201), Specular=RGB(0, 255, 255), Emission=RGB(0, 0, 0), Transparency=0.5, Shine=100)

create_material_26 = CreateMaterial(Diffuse=RGB(176, 176, 176), Specular=RGB(0, 255, 255), Emission=RGB(0, 0, 0), Transparency=0.5, Shine=100)
create_material_27 = CreateMaterial(Diffuse=RGB(201, 201, 201), Specular=RGB(0, 255, 255), Emission=RGB(0, 0, 0), Transparency=0.5, Shine=100)

create_material_28 = CreateMaterial(Diffuse=RGB(184, 184, 184), Specular=RGB(0, 255, 255), Emission=RGB(0, 0, 0), Transparency=0.5, Shine=100)
create_material_29 = CreateMaterial(Diffuse=RGB(209, 209, 209), Specular=RGB(0, 255, 255), Emission=RGB(0, 0, 0), Transparency=0.5, Shine=100)

create_material_30 = CreateMaterial(Diffuse=RGB(191, 191, 191), Specular=RGB(0, 255, 255), Emission=RGB(0, 0, 0), Transparency=0.5, Shine=100)
create_material_31 = CreateMaterial(Diffuse=RGB(217, 217, 217), Specular=RGB(0, 255, 255), Emission=RGB(0, 0, 0), Transparency=0.5, Shine=100)

create_material_32 = CreateMaterial(Diffuse=RGB(199, 199, 199), Specular=RGB(0, 255, 255), Emission=RGB(0, 0, 0), Transparency=0.5, Shine=100)
create_material_33 = CreateMaterial(Diffuse=RGB(224, 224, 224), Specular=RGB(0, 255, 255), Emission=RGB(0, 0, 0), Transparency=0.5, Shine=100)

create_material_34 = CreateMaterial(Diffuse=RGB(207, 207, 207), Specular=RGB(0, 255, 255), Emission=RGB(0, 0, 0), Transparency=0.5, Shine=100)
create_material_35 = CreateMaterial(Diffuse=RGB(232, 232, 232), Specular=RGB(0, 255, 255), Emission=RGB(0, 0, 0), Transparency=0.5, Shine=100)

create_material_36 = CreateMaterial(Diffuse=RGB(214, 214, 214), Specular=RGB(0, 255, 255), Emission=RGB(0, 0, 0), Transparency=0.5, Shine=100)
create_material_37 = CreateMaterial(Diffuse=RGB(240, 240, 240), Specular=RGB(0, 255, 255), Emission=RGB(0, 0, 0), Transparency=0.5, Shine=100)

scale_2 = Scale(Geometry=curve_9, Center=Point(0, 0, 0), Factor=expr("2^X", digit_scroller_2))  # -> Geometry, Transform
degrees_2 = Degrees(Radians=list_item_7)
power_3 = Power(A=2, B=digit_scroller)
one_over_x_2 = OneOverX(Value=power_3)
power_4 = Power(A=2, B=digit_scroller)
multiplication_3 = Multiplication(A=degrees_2, B=power_4)

bounds_2 = Bounds(Numbers=multiplication_3)
curve_10 = Curve(scale_2.Geometry)
end_points_2 = EndPoints(Curve=curve_10)  # -> Start, End
rectangle_2pt_2 = Rectangle2Pt(Plane=PlaneXY(0, 0, 0), PointA=end_points_2.Start, PointB=end_points_2.End, Radius=0)  # -> Rectangle, Length
graphmapper_2 = GraphMapper(Curve=curve_10, Boundary=rectangle_2pt_2.Rectangle, Numbers=multiplication_3, Input=bounds_2, Output=bounds_2)

multiplication_4 = Multiplication(A=graphmapper_2, B=one_over_x_2)
radians_6 = Radians(Degrees=multiplication_4)
panel_13 = Panel(radians_6)

turtle_3 = DotNETVBScriptLEGACY(Forward=list_item_3, Left=radians_6)  # -> Output, Points; inputs Forward: list, Left: list; same code as turtle
panel_14 = Panel(turtle_3.Points)
point_3 = Point(turtle_3.Points)
interpolate_t_3 = InterpolateT(Vertices=point_3, TangentStart=Vector(0, 0, 0), TangentEnd=Vector(0, 0, 0), KnotStyle=2)  # -> Curve, Length, Domain
curve_11 = Curve(interpolate_t_3.Curve)
evaluate_length_6 = EvaluateLength(Curve=curve_11, Length=1, Normalized=True)  # -> Point, Tangent, Parameter
curve_12 = Curve(curve_11)
rotate_3 = Rotate(Geometry=curve_12, Angle=3.141592654, Plane=evaluate_length_6.Point)  # -> Geometry, Transform
merge_3 = Merge(Data1=curve_12, Data2=rotate_3.Geometry)
join_curves_3 = JoinCurves(Curves=merge_3, Preserve=False)
evaluate_length_7 = EvaluateLength(Curve=join_curves_3, Length=1, Normalized=True)  # -> Point, Tangent, Parameter
deconstruct_3 = Deconstruct(Point=evaluate_length_7.Point)  # -> XComponent, YComponent, ZComponent
scale_nu_3 = ScaleNU(
    Geometry=join_curves_3,
    Plane=PlaneXY(0, 0, 0),
    ScaleX=expr("1/X", deconstruct_3.XComponent),
    ScaleY=expr("1/X", deconstruct_3.YComponent),
    ScaleZ=1)  # -> Geometry, Transform
division_3 = Division(A=deconstruct_3.XComponent, B=deconstruct_3.YComponent)
format_3 = Format(Format="{0:R}", Culture=127, Data0=division_3)
panel_15 = Panel(format_3)
scaled_3 = StreamFilter(Gate=boolean_toggle, Stream0=join_curves_3, Stream1=scale_nu_3.Geometry)
curve_13 = Curve(scaled_3)

curve_14 = Curve(curve_13)

number_3 = Number(number_2)

number_4 = Number(number_3)

number_5 = Number(number_4)

divide_curve = DivideCurve(Curve=line_sdl_3, Count=number_5, Kinks=False)  # -> Points, Tangents, Parameters

number_6 = Number(number_4)
number_7 = Number(number_6)

scale_3 = Scale(Geometry=curve_14, Center=Point(0, 0, 0), Factor=expr("2^X", digit_scroller_2))  # -> Geometry, Transform
degrees_3 = Degrees(Radians=list_item_8)
power_5 = Power(A=2, B=digit_scroller)
one_over_x_3 = OneOverX(Value=power_5)
power_6 = Power(A=2, B=digit_scroller)
multiplication_5 = Multiplication(A=degrees_3, B=power_6)

bounds_3 = Bounds(Numbers=multiplication_5)
curve_15 = Curve(scale_3.Geometry)
end_points_3 = EndPoints(Curve=curve_15)  # -> Start, End
rectangle_2pt_3 = Rectangle2Pt(Plane=PlaneXY(0, 0, 0), PointA=end_points_3.Start, PointB=end_points_3.End, Radius=0)  # -> Rectangle, Length
graphmapper_3 = GraphMapper(Curve=curve_15, Boundary=rectangle_2pt_3.Rectangle, Numbers=multiplication_5, Input=bounds_3, Output=bounds_3)

multiplication_6 = Multiplication(A=graphmapper_3, B=one_over_x_3)
radians_7 = Radians(Degrees=multiplication_6)
panel_16 = Panel(radians_7)

turtle_4 = DotNETVBScriptLEGACY(Forward=list_item_4, Left=radians_7)  # -> Output, Points; inputs Forward: list, Left: list; same code as turtle
panel_17 = Panel(turtle_4.Points)
point_4 = Point(turtle_4.Points)
interpolate_t_4 = InterpolateT(Vertices=point_4, TangentStart=Vector(0, 0, 0), TangentEnd=Vector(0, 0, 0), KnotStyle=2)  # -> Curve, Length, Domain
curve_16 = Curve(interpolate_t_4.Curve)
evaluate_length_8 = EvaluateLength(Curve=curve_16, Length=1, Normalized=True)  # -> Point, Tangent, Parameter
curve_17 = Curve(curve_16)
rotate_4 = Rotate(Geometry=curve_17, Angle=3.141592654, Plane=evaluate_length_8.Point)  # -> Geometry, Transform
merge_4 = Merge(Data1=curve_17, Data2=rotate_4.Geometry)
join_curves_4 = JoinCurves(Curves=merge_4, Preserve=False)
evaluate_length_9 = EvaluateLength(Curve=join_curves_4, Length=1, Normalized=True)  # -> Point, Tangent, Parameter
deconstruct_4 = Deconstruct(Point=evaluate_length_9.Point)  # -> XComponent, YComponent, ZComponent
scale_nu_4 = ScaleNU(
    Geometry=join_curves_4,
    Plane=PlaneXY(0, 0, 0),
    ScaleX=expr("1/X", deconstruct_4.XComponent),
    ScaleY=expr("1/X", deconstruct_4.YComponent),
    ScaleZ=1)  # -> Geometry, Transform
division_4 = Division(A=deconstruct_4.XComponent, B=deconstruct_4.YComponent)
format_4 = Format(Format="{0:R}", Culture=127, Data0=division_4)
panel_18 = Panel(format_4)
scaled_4 = StreamFilter(Gate=boolean_toggle, Stream0=join_curves_4, Stream1=scale_nu_4.Geometry)
curve_18 = Curve(scaled_4)

curve_19 = Curve(curve_18)
evaluate_length_10 = EvaluateLength(Curve=curve_19, Length=1, Normalized=True)  # -> Point, Tangent, Parameter
deconstruct_5 = Deconstruct(Point=evaluate_length_10.Point)  # -> XComponent, YComponent, ZComponent
scale_nu_5 = ScaleNU(
    Geometry=curve_19,
    Plane=PlaneXY(0, 0, 0),
    ScaleX=expr("1/X", deconstruct_5.XComponent),
    ScaleY=expr("1/X", deconstruct_5.YComponent),
    ScaleZ=1)  # -> Geometry, Transform
scaled_5 = StreamFilter(SCALEDTO11=boolean_toggle, Stream0=scale_nu_5.Geometry, Stream1=curve_19)
curve_20 = Curve(scaled_5)

curve_21 = Curve(graft(curve_20))

curve_22 = Curve(graft(curve_21))
divide_curve_2 = DivideCurve(Curve=curve_22, Count=number_6, Kinks=False)  # -> Points, Tangents, Parameters
curvature = Curvature(Curve=curve_22, Parameter=divide_curve_2.Parameters)  # -> Point, Curvature, Curvature_2
deconstruct_arc = DeconstructArc(Arc=curvature.Curvature_2)  # -> BasePlane, Radius, Angle
line = Line(StartPoint=curvature.Point, EndPoint=deconstruct_arc.BasePlane)
length = Length(Curve=curve_22)
one_over_x_4 = OneOverX(Value=deconstruct_arc.Radius)
expression_5 = Expression(O=one_over_x_4, Expression="FORMAT(\"{0:R}\",O)")  # disabled
panel_19 = Panel(expression_5)
quick_graph_8 = QuickGraph(one_over_x_4, SortOrder=0)
bounds_4 = Bounds(Numbers=one_over_x_4)
remap_numbers = RemapNumbers(Value=one_over_x_4, Source=bounds_4, Target=Domain(0, 1))  # -> Mapped, Clipped
multiplication_7 = Multiplication(A=length, B=remap_numbers.Mapped)
multiplication_8 = Multiplication(A=multiplication_7, B=digit_scroller_18)
line_sdl_4 = LineSDL(Start=curvature.Point, Direction=curvature.Curvature, Length=expr("-X", multiplication_8))
evaluate_length_11 = EvaluateLength(Curve=line_sdl_4, Length=1, Normalized=True)  # -> Point, Tangent, Parameter
interpolate_2 = Interpolate(Vertices=evaluate_length_11.Point, Degree=1, Periodic=False, KnotStyle=2)  # -> Curve, Length, Domain
custom_preview_3 = CustomPreview(Geometry=line_sdl_4, Material=create_material_22)
custom_preview_4 = CustomPreview(Geometry=curve_22, Material=create_material_23)
curvature_graph = CurvatureGraph(Curve=curve_22, Density=1, Scale=digit_scroller_17)  # disabled
curve_23 = Curve(interpolate_2.Curve)
custom_preview_5 = CustomPreview(Geometry=curve_23, Material=create_material_21)

expression_6 = Expression(O=deconstruct_arc.Radius, Expression="FORMAT(\"{0:R}\",O)")  # disabled
panel_20 = Panel(expression_6)

replace_nulls = ReplaceNulls(Items=one_over_x_4, Replacements=0)  # -> Items, Count
relative_differences = RelativeDifferences(Values=replace_nulls.Items)
list_length_9 = ListLength(List=relative_differences)
series_13 = Series(Start=1, Step=1, Count=expr("X-1", list_length_9))
list_item_9 = ListItem(List=relative_differences, Index=series_13, Wrap=False)

expression_7 = Expression(O=list_item_9, Expression="FORMAT(\"{0:R}\",O)")  # disabled
panel_21 = Panel(expression_7)

replace_nulls_2 = ReplaceNulls(Items=list_item_9, Replacements=0)  # -> Items, Count
relative_differences_2 = RelativeDifferences(Values=replace_nulls_2.Items)
list_length_10 = ListLength(List=relative_differences_2)
series_14 = Series(Start=1, Step=1, Count=expr("X-1", list_length_10))
list_item_10 = ListItem(List=relative_differences_2, Index=series_14, Wrap=False)

expression_8 = Expression(O=list_item_10, Expression="FORMAT(\"{0:R}\",O)")  # disabled
panel_22 = Panel(expression_8)

replace_nulls_3 = ReplaceNulls(Items=list_item_10, Replacements=0)  # -> Items, Count
relative_differences_3 = RelativeDifferences(Values=replace_nulls_3.Items)
list_length_11 = ListLength(List=relative_differences_3)
series_15 = Series(Start=1, Step=1, Count=expr("X-1", list_length_11))
list_item_11 = ListItem(List=relative_differences_3, Index=series_15, Wrap=False)

expression_9 = Expression(O=list_item_11, Expression="FORMAT(\"{0:R}\",O)")  # disabled
panel_23 = Panel(expression_9)

replace_nulls_4 = ReplaceNulls(Items=list_item_11, Replacements=0)  # -> Items, Count
relative_differences_4 = RelativeDifferences(Values=replace_nulls_4.Items)
list_length_12 = ListLength(List=relative_differences_4)
series_16 = Series(Start=1, Step=1, Count=expr("X-1", list_length_12))
list_item_12 = ListItem(List=relative_differences_4, Index=series_16, Wrap=False)

expression_10 = Expression(O=list_item_12, Expression="FORMAT(\"{0:R}\",O)")  # disabled
panel_24 = Panel(expression_10)

replace_nulls_5 = ReplaceNulls(Items=list_item_12, Replacements=0)  # -> Items, Count
relative_differences_5 = RelativeDifferences(Values=replace_nulls_5.Items)
list_length_13 = ListLength(List=relative_differences_5)
series_17 = Series(Start=1, Step=1, Count=expr("X-1", list_length_13))
list_item_13 = ListItem(List=relative_differences_5, Index=series_17, Wrap=False)

expression_11 = Expression(O=list_item_13, Expression="FORMAT(\"{0:R}\",O)")  # disabled
panel_25 = Panel(expression_11)

replace_nulls_6 = ReplaceNulls(Items=list_item_13, Replacements=0)  # -> Items, Count
relative_differences_6 = RelativeDifferences(Values=replace_nulls_6.Items)
list_length_14 = ListLength(List=relative_differences_6)
series_18 = Series(Start=1, Step=1, Count=expr("X-1", list_length_14))
list_item_14 = ListItem(List=relative_differences_6, Index=series_18, Wrap=False)

expression_12 = Expression(O=list_item_14, Expression="FORMAT(\"{0:R}\",O)")  # disabled
panel_26 = Panel(expression_12)

replace_nulls_7 = ReplaceNulls(Items=list_item_14, Replacements=0)  # -> Items, Count
relative_differences_7 = RelativeDifferences(Values=replace_nulls_7.Items)
list_length_15 = ListLength(List=relative_differences_7)
series_19 = Series(Start=1, Step=1, Count=expr("X-1", list_length_15))
list_item_15 = ListItem(List=relative_differences_7, Index=series_19, Wrap=False)

expression_13 = Expression(O=list_item_15, Expression="FORMAT(\"{0:R}\",O)")  # disabled
panel_27 = Panel(expression_13)

explode = Explode(Curve=curve_23, Recursive=True)  # -> Segments, Vertices
evaluate_length_12 = EvaluateLength(Curve=explode.Segments, Length=0.5, Normalized=True)  # -> Point, Tangent, Parameter
curve_closest_point = CurveClosestPoint(Point=evaluate_length_12.Point, Curve=curve_22)  # -> Point, Parameter, Distance
line_2 = Line(StartPoint=curve_closest_point.Point, EndPoint=evaluate_length_12.Point)

bounds_5 = Bounds(Numbers=list_item_15)
remap_numbers_2 = RemapNumbers(Value=list_item_15, Source=bounds_5, Target=Domain(-1, 1))  # -> Mapped, Clipped
multiplication_9 = Multiplication(A=length, B=remap_numbers_2.Mapped)
multiplication_10 = Multiplication(A=multiplication_9, B=digit_scroller_19)

bounds_6 = Bounds(Numbers=list_item_14)
remap_numbers_3 = RemapNumbers(Value=list_item_14, Source=bounds_6, Target=Domain(-1, 1))  # -> Mapped, Clipped
multiplication_11 = Multiplication(A=length, B=remap_numbers_3.Mapped)
multiplication_12 = Multiplication(A=multiplication_11, B=digit_scroller_14)

bounds_7 = Bounds(Numbers=list_item_13)
remap_numbers_4 = RemapNumbers(Value=list_item_13, Source=bounds_7, Target=Domain(-1, 1))  # -> Mapped, Clipped
multiplication_13 = Multiplication(A=length, B=remap_numbers_4.Mapped)
multiplication_14 = Multiplication(A=multiplication_13, B=digit_scroller_20)

bounds_8 = Bounds(Numbers=list_item_12)
remap_numbers_5 = RemapNumbers(Value=list_item_12, Source=bounds_8, Target=Domain(-1, 1))  # -> Mapped, Clipped
multiplication_15 = Multiplication(A=length, B=remap_numbers_5.Mapped)
multiplication_16 = Multiplication(A=multiplication_15, B=digit_scroller_15)

bounds_9 = Bounds(Numbers=list_item_11)
remap_numbers_6 = RemapNumbers(Value=list_item_11, Source=bounds_9, Target=Domain(-1, 1))  # -> Mapped, Clipped
multiplication_17 = Multiplication(A=length, B=remap_numbers_6.Mapped)
multiplication_18 = Multiplication(A=multiplication_17, B=digit_scroller_21)

bounds_10 = Bounds(Numbers=list_item_10)
remap_numbers_7 = RemapNumbers(Value=list_item_10, Source=bounds_10, Target=Domain(-1, 1))  # -> Mapped, Clipped
multiplication_19 = Multiplication(A=length, B=remap_numbers_7.Mapped)
multiplication_20 = Multiplication(A=multiplication_19, B=digit_scroller_22)

bounds_11 = Bounds(Numbers=list_item_9)
remap_numbers_8 = RemapNumbers(Value=list_item_9, Source=bounds_11, Target=Domain(-1, 1))  # -> Mapped, Clipped
multiplication_21 = Multiplication(A=length, B=remap_numbers_8.Mapped)
multiplication_22 = Multiplication(A=multiplication_21, B=digit_scroller_23)

quick_graph_9 = QuickGraph(list_item_9, SortOrder=0)
line_sdl_5 = LineSDL(Start=evaluate_length_12.Point, Direction=line_2, Length=expr("ABS(X)", multiplication_22))
evaluate_length_13 = EvaluateLength(Curve=line_sdl_5, Length=1, Normalized=True)  # -> Point, Tangent, Parameter
interpolate_3 = Interpolate(Vertices=evaluate_length_13.Point, Degree=1, Periodic=False, KnotStyle=2)  # -> Curve, Length, Domain
custom_preview_6 = CustomPreview(Geometry=interpolate_3.Curve, Material=create_material_36)
custom_preview_7 = CustomPreview(Geometry=line_sdl_5, Material=create_material_37)

explode_2 = Explode(Curve=interpolate_3.Curve, Recursive=True)  # -> Segments, Vertices
evaluate_length_14 = EvaluateLength(Curve=explode_2.Segments, Length=0.5, Normalized=True)  # -> Point, Tangent, Parameter
curve_closest_point_2 = CurveClosestPoint(Point=evaluate_length_14.Point, Curve=curve_22)  # -> Point, Parameter, Distance
line_3 = Line(StartPoint=curve_closest_point_2.Point, EndPoint=evaluate_length_14.Point)

quick_graph_10 = QuickGraph(list_item_10, SortOrder=0)
line_sdl_6 = LineSDL(Start=evaluate_length_14.Point, Direction=line_3, Length=expr("ABS(X)", multiplication_20))
evaluate_length_15 = EvaluateLength(Curve=line_sdl_6, Length=1, Normalized=True)  # -> Point, Tangent, Parameter
interpolate_4 = Interpolate(Vertices=evaluate_length_15.Point, Degree=1, Periodic=False, KnotStyle=2)  # -> Curve, Length, Domain
custom_preview_8 = CustomPreview(Geometry=interpolate_4.Curve, Material=create_material_34)
custom_preview_9 = CustomPreview(Geometry=line_sdl_6, Material=create_material_35)

explode_3 = Explode(Curve=interpolate_4.Curve, Recursive=True)  # -> Segments, Vertices
evaluate_length_16 = EvaluateLength(Curve=explode_3.Segments, Length=0.5, Normalized=True)  # -> Point, Tangent, Parameter
curve_closest_point_3 = CurveClosestPoint(Point=evaluate_length_16.Point, Curve=curve_22)  # -> Point, Parameter, Distance
line_4 = Line(StartPoint=curve_closest_point_3.Point, EndPoint=evaluate_length_16.Point)

quick_graph_11 = QuickGraph(list_item_11, SortOrder=0)
line_sdl_7 = LineSDL(Start=evaluate_length_16.Point, Direction=line_4, Length=expr("ABS(X)", multiplication_18))
evaluate_length_17 = EvaluateLength(Curve=line_sdl_7, Length=1, Normalized=True)  # -> Point, Tangent, Parameter
interpolate_5 = Interpolate(Vertices=evaluate_length_17.Point, Degree=1, Periodic=False, KnotStyle=2)  # -> Curve, Length, Domain
custom_preview_10 = CustomPreview(Geometry=interpolate_5.Curve, Material=create_material_32)
custom_preview_11 = CustomPreview(Geometry=line_sdl_7, Material=create_material_33)

explode_4 = Explode(Curve=interpolate_5.Curve, Recursive=True)  # -> Segments, Vertices
evaluate_length_18 = EvaluateLength(Curve=explode_4.Segments, Length=0.5, Normalized=True)  # -> Point, Tangent, Parameter
curve_closest_point_4 = CurveClosestPoint(Point=evaluate_length_18.Point, Curve=curve_22)  # -> Point, Parameter, Distance
line_5 = Line(StartPoint=curve_closest_point_4.Point, EndPoint=evaluate_length_18.Point)

quick_graph_12 = QuickGraph(list_item_12, SortOrder=0)
line_sdl_8 = LineSDL(Start=evaluate_length_18.Point, Direction=line_5, Length=expr("ABS(X)", multiplication_16))
evaluate_length_19 = EvaluateLength(Curve=line_sdl_8, Length=1, Normalized=True)  # -> Point, Tangent, Parameter
interpolate_6 = Interpolate(Vertices=evaluate_length_19.Point, Degree=1, Periodic=False, KnotStyle=2)  # -> Curve, Length, Domain
custom_preview_12 = CustomPreview(Geometry=interpolate_6.Curve, Material=create_material_30)
custom_preview_13 = CustomPreview(Geometry=line_sdl_8, Material=create_material_31)

explode_5 = Explode(Curve=interpolate_6.Curve, Recursive=True)  # -> Segments, Vertices
evaluate_length_20 = EvaluateLength(Curve=explode_5.Segments, Length=0.5, Normalized=True)  # -> Point, Tangent, Parameter
curve_closest_point_5 = CurveClosestPoint(Point=evaluate_length_20.Point, Curve=curve_22)  # -> Point, Parameter, Distance
line_6 = Line(StartPoint=curve_closest_point_5.Point, EndPoint=evaluate_length_20.Point)

quick_graph_13 = QuickGraph(list_item_13, SortOrder=0)
line_sdl_9 = LineSDL(Start=evaluate_length_20.Point, Direction=line_6, Length=expr("ABS(X)", multiplication_14))
evaluate_length_21 = EvaluateLength(Curve=line_sdl_9, Length=1, Normalized=True)  # -> Point, Tangent, Parameter
interpolate_7 = Interpolate(Vertices=evaluate_length_21.Point, Degree=1, Periodic=False, KnotStyle=2)  # -> Curve, Length, Domain
custom_preview_14 = CustomPreview(Geometry=interpolate_7.Curve, Material=create_material_28)
custom_preview_15 = CustomPreview(Geometry=line_sdl_9, Material=create_material_29)

explode_6 = Explode(Curve=interpolate_7.Curve, Recursive=True)  # -> Segments, Vertices
evaluate_length_22 = EvaluateLength(Curve=explode_6.Segments, Length=0.5, Normalized=True)  # -> Point, Tangent, Parameter
curve_closest_point_6 = CurveClosestPoint(Point=evaluate_length_22.Point, Curve=curve_22)  # -> Point, Parameter, Distance
line_7 = Line(StartPoint=curve_closest_point_6.Point, EndPoint=evaluate_length_22.Point)

quick_graph_14 = QuickGraph(list_item_14, SortOrder=0)
line_sdl_10 = LineSDL(Start=evaluate_length_22.Point, Direction=line_7, Length=expr("ABS(X)", multiplication_12))
evaluate_length_23 = EvaluateLength(Curve=line_sdl_10, Length=1, Normalized=True)  # -> Point, Tangent, Parameter
interpolate_8 = Interpolate(Vertices=evaluate_length_23.Point, Degree=1, Periodic=False, KnotStyle=2)  # -> Curve, Length, Domain
custom_preview_16 = CustomPreview(Geometry=interpolate_8.Curve, Material=create_material_26)
custom_preview_17 = CustomPreview(Geometry=line_sdl_10, Material=create_material_27)

explode_7 = Explode(Curve=interpolate_8.Curve, Recursive=True)  # -> Segments, Vertices
evaluate_length_24 = EvaluateLength(Curve=explode_7.Segments, Length=0.5, Normalized=True)  # -> Point, Tangent, Parameter
curve_closest_point_7 = CurveClosestPoint(Point=evaluate_length_24.Point, Curve=curve_22)  # -> Point, Parameter, Distance
line_8 = Line(StartPoint=curve_closest_point_7.Point, EndPoint=evaluate_length_24.Point)

quick_graph_15 = QuickGraph(list_item_15, SortOrder=0)
line_sdl_11 = LineSDL(Start=evaluate_length_24.Point, Direction=line_8, Length=expr("ABS(X)", multiplication_10))
evaluate_length_25 = EvaluateLength(Curve=line_sdl_11, Length=1, Normalized=True)  # -> Point, Tangent, Parameter
interpolate_9 = Interpolate(Vertices=evaluate_length_25.Point, Degree=1, Periodic=False, KnotStyle=2)  # -> Curve, Length, Domain
custom_preview_18 = CustomPreview(Geometry=interpolate_9.Curve, Material=create_material_24)
custom_preview_19 = CustomPreview(Geometry=line_sdl_11, Material=create_material_25)

button = Button()  # disabled
file_path = FilePath("C:\VSC.O____STNEMGES_215____ERUTAWRUC_RAENIL_DEPAM_EMIT_1_HTOMS_LEVEL_4_DIOMGIS_NOITISNART_EGDE_LUF____O____FUL_EDGE_TRANSITION_SIGMOID_4_LEVEL_SMOTH_1_TIME_MAPED_LINEAR_CURWATURE____512_SEGMENTS____O.CSV")  # disabled
curve_24 = Curve(curve_22)  # disabled
number_8 = Number(number_6)  # disabled
divide_curve_3 = DivideCurve(Curve=curve_24, Count=number_8, Kinks=False)  # -> Points, Tangents, Parameters; disabled
deconstruct_6 = Deconstruct(Point=divide_curve_3.Points)  # -> graft(XComponent), graft(YComponent), ZComponent; disabled
expression_14 = Expression(X=deconstruct_6.XComponent, Expression="FORMAT(\"{0:R}\",ROUND(X, 15))")  # -> simplify(Result); disabled
expression_15 = Expression(Y=deconstruct_6.YComponent, Expression="FORMAT(\"{0:R}\",ROUND(Y, 15))")  # -> simplify(Result); disabled
expression_16 = Expression(Y=deconstruct_6.YComponent, Expression="FORMAT(\"{0:R}\",Y)")  # -> simplify(Result); disabled
expression_17 = Expression(X=deconstruct_6.XComponent, Expression="FORMAT(\"{0:R}\",X)")  # -> simplify(Result); disabled
panel_28 = Panel(expression_17)  # disabled
panel_29 = Panel(expression_16)  # disabled
curvature_2 = Curvature(Curve=curve_24, Parameter=divide_curve_3.Parameters)  # -> Point, Curvature, Curvature_2; disabled
deconstruct_arc_2 = DeconstructArc(Arc=curvature_2.Curvature_2)  # -> BasePlane, Radius, Angle; disabled
one_over_x_5 = OneOverX(Value=deconstruct_arc_2.Radius)  # -> graft(Result); disabled
expression_18 = Expression(X=one_over_x_5, Expression="FORMAT(\"{0:R}\",X)")  # -> simplify(Result); disabled
list_length_16 = ListLength(List=divide_curve_3.Points)  # disabled
duplicate_data_5 = DuplicateData(Data=",", Number=list_length_16, Order=True)  # -> simplify(graft(Data)); disabled
panel_30 = Panel(duplicate_data_5)  # disabled
panel_31 = Panel(duplicate_data_5)  # disabled
panel_32 = Panel(expression_18)  # disabled
concatenate = Concatenate(FragmentA=panel_28, FragmentB=panel_30, FragmentA_2=panel_29, FragmentA_3=panel_31, FragmentB_2=panel_32)  # -> flatten(Result); disabled
panel_33 = Panel(concatenate)  # disabled
txtwriter = VBScript(filePath=file_path, data=flatten(panel_33), activate=button)  # -> out, A; inputs data: list; disabled
# ---------- txtwriter: VB ----------
    If activate Then

      Dim i As Integer
      Dim aryText(4) As String

      aryText(0) = "Mary WriteLine"
      aryText(1) = "Had"
      aryText(2) = "Another"
      aryText(3) = "Little"
      aryText(4) = "One"

      ' the data is appended to the file. If file doesnt exist, a new file is created
      Dim objWriter As New System.IO.StreamWriter(filePath, append)

      For i = 0 To data.Count - 1
        objWriter.WriteLine(data(i))
      Next

      objWriter.Close()

    End If

    If clearFile Then
      Dim objWriter As New System.IO.StreamWriter(filePath, False)
      objWriter.Close()
    End If
# ---------- end txtwriter ----------

curve_25 = Curve(graft(curve_21))
divide_curve_4 = DivideCurve(Curve=curve_25, Count=number_5, Kinks=False)  # -> Points, Tangents, Parameters
curvature_3 = Curvature(Curve=curve_25, Parameter=divide_curve_4.Parameters)  # -> Point, Curvature, Curvature_2
deconstruct_arc_3 = DeconstructArc(Arc=curvature_3.Curvature_2)  # -> BasePlane, Radius, Angle
expression_19 = Expression(O=deconstruct_arc_3.Radius, Expression="FORMAT(\"{0:R}\",O)")
panel_34 = Panel(expression_19)
quick_graph_16 = QuickGraph(deconstruct_arc_3.Radius, SortOrder=0)
one_over_x_6 = OneOverX(Value=deconstruct_arc_3.Radius)

expression_20 = Expression(O=one_over_x_6, Expression="FORMAT(\"{0:R}\",O)")
panel_35 = Panel(expression_20)

replace_nulls_8 = ReplaceNulls(Items=one_over_x_6, Replacements=0)  # -> Items, Count
relative_differences_8 = RelativeDifferences(Values=replace_nulls_8.Items)

quick_graph_17 = QuickGraph(one_over_x_6, SortOrder=0)
multiplication_23 = Multiplication(A=one_over_x_6, B=digit_scroller_13)
line_sdl_12 = LineSDL(Start=divide_curve.Points, Direction=Vector(0, 1, 0), Length=multiplication_23)

curve_26 = Curve(line_sdl_12)

list_length_17 = ListLength(List=curve_25)  # -> flatten(Length)
mass_addition = MassAddition(Input=list_length_17)  # -> Result, PartialResults
panel_36 = Panel(mass_addition.Result)
series_20 = Series(Start=1, Step=1, Count=panel_36)  # -> graft(Series)
vector_xyz = VectorXYZ(XComponent=expr("-X", series_20), YComponent=0, ZComponent=0)  # -> Vector, Length
move = Move(Geometry=curve_26, Motion=vector_xyz.Vector)  # -> Geometry, Transform
evaluate_length_26 = EvaluateLength(Curve=move.Geometry, Length=1, Normalized=True)  # -> Point, Tangent, Parameter
interpolate_10 = Interpolate(Vertices=evaluate_length_26.Point, Degree=1, Periodic=False, KnotStyle=2)  # -> Curve, Length, Domain

expression_21 = Expression(O=relative_differences_8, Expression="FORMAT(\"{0:R}\",O)")
panel_37 = Panel(expression_21)
vector_xyz_2 = VectorXYZ(XComponent=expr("-X", series_20), YComponent=0.5, ZComponent=0)  # -> Vector, Length
quick_graph_18 = QuickGraph(relative_differences_8, SortOrder=0)
multiplication_24 = Multiplication(A=relative_differences_8, B=digit_scroller_9)
line_sdl_13 = LineSDL(Start=divide_curve.Points, Direction=Vector(0, 1, 0), Length=multiplication_24)
move_2 = Move(Geometry=line_sdl_13, Motion=vector_xyz_2.Vector)  # -> Geometry, Transform
evaluate_length_27 = EvaluateLength(Curve=move_2.Geometry, Length=1, Normalized=True)  # -> Point, Tangent, Parameter
interpolate_11 = Interpolate(Vertices=evaluate_length_27.Point, Degree=1, Periodic=False, KnotStyle=2)  # -> Curve, Length, Domain

vector_xyz_3 = VectorXYZ(XComponent=expr("-X", series_20), YComponent=1, ZComponent=0)  # -> Vector, Length
replace_nulls_9 = ReplaceNulls(Items=relative_differences_8, Replacements=0)  # -> Items, Count
relative_differences_9 = RelativeDifferences(Values=replace_nulls_9.Items)
expression_22 = Expression(O=relative_differences_9, Expression="FORMAT(\"{0:R}\",O)")
panel_38 = Panel(expression_22)
quick_graph_19 = QuickGraph(relative_differences_9, SortOrder=0)
multiplication_25 = Multiplication(A=relative_differences_9, B=digit_scroller_7)
line_sdl_14 = LineSDL(Start=divide_curve.Points, Direction=Vector(0, 1, 0), Length=multiplication_25)
move_3 = Move(Geometry=line_sdl_14, Motion=vector_xyz_3.Vector)  # -> Geometry, Transform
evaluate_length_28 = EvaluateLength(Curve=move_3.Geometry, Length=1, Normalized=True)  # -> Point, Tangent, Parameter
interpolate_12 = Interpolate(Vertices=evaluate_length_28.Point, Degree=1, Periodic=False, KnotStyle=2)  # -> Curve, Length, Domain

vector_xyz_4 = VectorXYZ(XComponent=expr("-X", series_20), YComponent=1.5, ZComponent=0)  # -> Vector, Length
replace_nulls_10 = ReplaceNulls(Items=relative_differences_9, Replacements=0)  # -> Items, Count
relative_differences_10 = RelativeDifferences(Values=replace_nulls_10.Items)
expression_23 = Expression(O=relative_differences_10, Expression="FORMAT(\"{0:R}\",O)")
panel_39 = Panel(expression_23)
quick_graph_20 = QuickGraph(relative_differences_10, SortOrder=0)
multiplication_26 = Multiplication(A=relative_differences_10, B=digit_scroller_6)
line_sdl_15 = LineSDL(Start=divide_curve.Points, Direction=Vector(0, 1, 0), Length=multiplication_26)
move_4 = Move(Geometry=line_sdl_15, Motion=vector_xyz_4.Vector)  # -> Geometry, Transform
evaluate_length_29 = EvaluateLength(Curve=move_4.Geometry, Length=1, Normalized=True)  # -> Point, Tangent, Parameter
interpolate_13 = Interpolate(Vertices=evaluate_length_29.Point, Degree=1, Periodic=False, KnotStyle=2)  # -> Curve, Length, Domain

vector_xyz_5 = VectorXYZ(XComponent=expr("-X", series_20), YComponent=2, ZComponent=0)  # -> Vector, Length
replace_nulls_11 = ReplaceNulls(Items=relative_differences_10, Replacements=0)  # -> Items, Count
relative_differences_11 = RelativeDifferences(Values=replace_nulls_11.Items)
expression_24 = Expression(O=relative_differences_11, Expression="FORMAT(\"{0:R}\",O)")
panel_40 = Panel(expression_24)
quick_graph_21 = QuickGraph(relative_differences_11, SortOrder=0)
multiplication_27 = Multiplication(A=relative_differences_11, B=digit_scroller_5)
line_sdl_16 = LineSDL(Start=divide_curve.Points, Direction=Vector(0, 1, 0), Length=multiplication_27)
move_5 = Move(Geometry=line_sdl_16, Motion=vector_xyz_5.Vector)  # -> Geometry, Transform
evaluate_length_30 = EvaluateLength(Curve=move_5.Geometry, Length=1, Normalized=True)  # -> Point, Tangent, Parameter
interpolate_14 = Interpolate(Vertices=evaluate_length_30.Point, Degree=1, Periodic=False, KnotStyle=2)  # -> Curve, Length, Domain

vector_xyz_6 = VectorXYZ(XComponent=expr("-X", series_20), YComponent=5, ZComponent=0)  # -> Vector, Length; disabled
replace_nulls_12 = ReplaceNulls(Items=relative_differences_11, Replacements=0)  # -> Items, Count; disabled
relative_differences_12 = RelativeDifferences(Values=replace_nulls_12.Items)  # disabled
expression_25 = Expression(O=relative_differences_12, Expression="FORMAT(\"{0:R}\",O)")  # disabled
panel_41 = Panel(expression_25)  # disabled
quick_graph_22 = QuickGraph(relative_differences_12, SortOrder=0)  # disabled
multiplication_28 = Multiplication(A=relative_differences_12, B=digit_scroller_10)  # disabled
line_sdl_17 = LineSDL(Start=divide_curve.Points, Direction=Vector(0, 1, 0), Length=multiplication_28)  # disabled
move_6 = Move(Geometry=line_sdl_17, Motion=vector_xyz_6.Vector)  # -> Geometry, Transform; disabled
evaluate_length_31 = EvaluateLength(Curve=move_6.Geometry, Length=1, Normalized=True)  # -> Point, Tangent, Parameter; disabled
interpolate_15 = Interpolate(Vertices=evaluate_length_31.Point, Degree=1, Periodic=False, KnotStyle=2)  # -> Curve, Length, Domain; disabled

replace_nulls_13 = ReplaceNulls(Items=relative_differences_12, Replacements=0)  # -> Items, Count; disabled
relative_differences_13 = RelativeDifferences(Values=replace_nulls_13.Items)  # disabled

expression_26 = Expression(O=relative_differences_13, Expression="FORMAT(\"{0:R}\",O)")  # disabled
panel_42 = Panel(expression_26)  # disabled
vector_xyz_7 = VectorXYZ(XComponent=expr("-X", series_20), YComponent=6, ZComponent=0)  # -> Vector, Length; disabled
quick_graph_23 = QuickGraph(relative_differences_13, SortOrder=0)  # disabled
multiplication_29 = Multiplication(A=relative_differences_13, B=digit_scroller_11)  # disabled
line_sdl_18 = LineSDL(Start=divide_curve.Points, Direction=Vector(0, 1, 0), Length=multiplication_29)  # disabled
move_7 = Move(Geometry=line_sdl_18, Motion=vector_xyz_7.Vector)  # -> Geometry, Transform; disabled
evaluate_length_32 = EvaluateLength(Curve=move_7.Geometry, Length=1, Normalized=True)  # -> Point, Tangent, Parameter; disabled
interpolate_16 = Interpolate(Vertices=evaluate_length_32.Point, Degree=1, Periodic=False, KnotStyle=2)  # -> Curve, Length, Domain; disabled

vector_xyz_8 = VectorXYZ(XComponent=expr("-X", series_20), YComponent=7, ZComponent=0)  # -> Vector, Length; disabled
replace_nulls_14 = ReplaceNulls(Items=relative_differences_13, Replacements=0)  # -> Items, Count; disabled
relative_differences_14 = RelativeDifferences(Values=replace_nulls_14.Items)  # disabled
expression_27 = Expression(O=relative_differences_14, Expression="FORMAT(\"{0:R}\",O)")  # disabled
panel_43 = Panel(expression_27)  # disabled
quick_graph_24 = QuickGraph(relative_differences_14, SortOrder=0)  # disabled
multiplication_30 = Multiplication(A=relative_differences_14, B=digit_scroller_8)  # disabled
line_sdl_19 = LineSDL(Start=divide_curve.Points, Direction=Vector(0, 1, 0), Length=multiplication_30)  # disabled
move_8 = Move(Geometry=line_sdl_19, Motion=vector_xyz_8.Vector)  # -> Geometry, Transform; disabled
evaluate_length_33 = EvaluateLength(Curve=move_8.Geometry, Length=1, Normalized=True)  # -> Point, Tangent, Parameter; disabled
interpolate_17 = Interpolate(Vertices=evaluate_length_33.Point, Degree=1, Periodic=False, KnotStyle=2)  # -> Curve, Length, Domain; disabled

vector_xyz_9 = VectorXYZ(XComponent=expr("-X", series_20), YComponent=8, ZComponent=0)  # -> Vector, Length; disabled
replace_nulls_15 = ReplaceNulls(Items=relative_differences_14, Replacements=0)  # -> Items, Count; disabled
relative_differences_15 = RelativeDifferences(Values=replace_nulls_15.Items)  # disabled
expression_28 = Expression(O=relative_differences_15, Expression="FORMAT(\"{0:R}\",O)")  # disabled
panel_44 = Panel(expression_28)  # disabled
quick_graph_25 = QuickGraph(relative_differences_15, SortOrder=0)  # disabled
multiplication_31 = Multiplication(A=relative_differences_15, B=digit_scroller_12)  # disabled
line_sdl_20 = LineSDL(Start=divide_curve.Points, Direction=Vector(0, 1, 0), Length=multiplication_31)  # disabled
move_9 = Move(Geometry=line_sdl_20, Motion=vector_xyz_9.Vector)  # -> Geometry, Transform; disabled
evaluate_length_34 = EvaluateLength(Curve=move_9.Geometry, Length=1, Normalized=True)  # -> Point, Tangent, Parameter; disabled
interpolate_18 = Interpolate(Vertices=evaluate_length_34.Point, Degree=1, Periodic=False, KnotStyle=2)  # -> Curve, Length, Domain; disabled

custom_preview_20 = CustomPreview(Geometry=interpolate_14.Curve, Material=create_material_3)

custom_preview_21 = CustomPreview(Geometry=move_5.Geometry, Material=create_material_4)

custom_preview_22 = CustomPreview(Geometry=interpolate_13.Curve, Material=create_material_5)

custom_preview_23 = CustomPreview(Geometry=move_4.Geometry, Material=create_material_6)

custom_preview_24 = CustomPreview(Geometry=interpolate_12.Curve, Material=create_material_7)

custom_preview_25 = CustomPreview(Geometry=move_3.Geometry, Material=create_material_8)

custom_preview_26 = CustomPreview(Geometry=interpolate_11.Curve, Material=create_material_9)

custom_preview_27 = CustomPreview(Geometry=move_2.Geometry, Material=create_material_10)

custom_preview_28 = CustomPreview(Geometry=interpolate_18.Curve, Material=create_material_11)  # disabled

custom_preview_29 = CustomPreview(Geometry=move_9.Geometry, Material=create_material_12)  # disabled

custom_preview_30 = CustomPreview(Geometry=interpolate_17.Curve, Material=create_material_13)  # disabled

custom_preview_31 = CustomPreview(Geometry=move_8.Geometry, Material=create_material_14)  # disabled

custom_preview_32 = CustomPreview(Geometry=interpolate_15.Curve, Material=create_material_15)  # disabled

custom_preview_33 = CustomPreview(Geometry=move_6.Geometry, Material=create_material_16)  # disabled

custom_preview_34 = CustomPreview(Geometry=interpolate_16.Curve, Material=create_material_17)  # disabled

custom_preview_35 = CustomPreview(Geometry=move_7.Geometry, Material=create_material_18)  # disabled

custom_preview_36 = CustomPreview(Geometry=interpolate_10.Curve, Material=create_material_19)

custom_preview_37 = CustomPreview(Geometry=move.Geometry, Material=create_material_20)

mass_division = MassDivision(Numbers=deconstruct_arc_3.Radius)  # -> Divided, Partial
logarithm = Logarithm(Value=mass_division.Partial)
quick_graph_26 = QuickGraph(logarithm, SortOrder=0)
quick_graph_27 = QuickGraph(mass_division.Partial, SortOrder=0)
