# Grasshopper definition XHG.⠀⠀⠀⠀ⵙ옷✤ⓄᙏᔓᔕⵙᙁᗱᗴᗯᗱᗴᙁⵙⵈⵙᗝꖴⓄᙏᕤᕦꖴᔓᔕⵙᗱᗴᴥᑎ✤ᗩᗯᴥᑎᑐᑕⵙᴥᗩᗱᗴИNꖴᙁⵙᗝᗱᗴߦᗩᙏⵙᔓᔕᗱᗴᙏꖴ✤ⵙ∷ⵙИNⓄꖴ✤ꖴᔓᔕИNᗩᴥ✤ⵙᗱᗴᕤᕦᗝᗱᗴⵙᙁᑎꗳⵙ⠀⠀⠀⠀◯⠀⠀⠀⠀ⵙ⠀⠀⠀⠀◯⠀⠀⠀⠀ⵙꗳᑎᙁⵙᗱᗴᗝᕤᕦᗱᗴⵙ✤ᴥᗩИNᔓᔕꖴ✤ꖴⓄИNⵙ∷ⵙ✤ꖴᙏᗱᗴᔓᔕⵙᙏᗩߦᗱᗴᗝⵙᙁꖴИNᗱᗴᗩᴥⵙᑐᑕᑎᴥᗯᗩ✤ᑎᴥᗱᗴⵙᔓᔕꖴᕤᕦᙏⓄꖴᗝⵙⵈⵙᙁᗱᗴᗯᗱᗴᙁⵙᔓᔕᙏⓄ✤옷ⵙ⠀⠀⠀⠀.GHX (Grasshopper 1.0.7)
# plug-ins: Pufferfish, Heteroptera

panel = Panel("0.0000710748925500000001421")
panel_2 = Panel("0.0013733120705119695")
panel_4 = Panel("0.00000331207")
panel_5 = Panel("0.00137956207")
digit_scroller = DigitScroller(Scroller_Digits=12, Scroller_Prefix="Digit Scroller", Scroller_Radix=1, Scroller_Value=0.02196259374)
panel_7 = Panel(digit_scroller)
digit_scroller_2 = DigitScroller(Scroller_Digits=12, Scroller_Prefix="Digit Scroller", Scroller_Radix=1, Scroller_Value=7.7777e-05)
curve = Curve()
panel_9 = Panel("""0.00032220000
0.00000220000""")
panel_10 = Panel("0.00137956207*4*4*4*4")

digit_scroller_3 = DigitScroller(Scroller_Digits=12, Scroller_Prefix=" ", Scroller_Radix=6, Scroller_Value=0.13)

digit_scroller_4 = DigitScroller(Scroller_Digits=12, Scroller_Prefix=" ", Scroller_Radix=6, Scroller_Value=0.1)

digit_scroller_5 = DigitScroller(Scroller_Digits=12, Scroller_Prefix=" ", Scroller_Radix=3, Scroller_Value=0.17)

digit_scroller_6 = DigitScroller(Scroller_Digits=12, Scroller_Prefix="Digit Scroller", Scroller_Radix=9, Scroller_Value=57.5)

digit_scroller_7 = DigitScroller(Scroller_Digits=12, Scroller_Prefix="Digit Scroller", Scroller_Radix=1, Scroller_Value=7.5243e-06)
digit_scroller_8 = DigitScroller(Scroller_Digits=12, Scroller_Prefix="Digit Scroller", Scroller_Radix=1, Scroller_Value=7.7777e-05)
digit_scroller_9 = DigitScroller(Scroller_Digits=12, Scroller_Prefix="Digit Scroller", Scroller_Radix=1, Scroller_Value=0.02196259374)
panel_13 = Panel(digit_scroller_9)
digit_scroller_10 = DigitScroller(Scroller_Digits=12, Scroller_Prefix="Digit Scroller", Scroller_Radix=1, Scroller_Value=7.7777e-05)
digit_scroller_11 = DigitScroller(Scroller_Digits=12, Scroller_Prefix="Digit Scroller", Scroller_Radix=1, Scroller_Value=7.5243e-06)
digit_scroller_12 = DigitScroller(Scroller_Digits=12, Scroller_Prefix="Digit Scroller", Scroller_Radix=1, Scroller_Value=7.7777e-05)
digit_scroller_13 = DigitScroller(Scroller_Digits=12, Scroller_Prefix="Digit Scroller", Scroller_Radix=1, Scroller_Value=0.02196259374)
panel_19 = Panel(digit_scroller_13)
digit_scroller_14 = DigitScroller(Scroller_Digits=12, Scroller_Prefix="Digit Scroller", Scroller_Radix=1, Scroller_Value=7.7777e-05)
digit_scroller_15 = DigitScroller(Scroller_Digits=12, Scroller_Prefix="Digit Scroller", Scroller_Radix=1, Scroller_Value=7.5243e-06)
digit_scroller_16 = DigitScroller(Scroller_Digits=12, Scroller_Prefix="Digit Scroller", Scroller_Radix=1, Scroller_Value=7.7777e-05)
digit_scroller_17 = DigitScroller(Scroller_Digits=12, Scroller_Prefix="Digit Scroller", Scroller_Radix=1, Scroller_Value=0.02196259374)
panel_25 = Panel(digit_scroller_17)
digit_scroller_18 = DigitScroller(Scroller_Digits=12, Scroller_Prefix="Digit Scroller", Scroller_Radix=1, Scroller_Value=7.7777e-05)
digit_scroller_19 = DigitScroller(Scroller_Digits=12, Scroller_Prefix="Digit Scroller", Scroller_Radix=1, Scroller_Value=0.02196259374)
panel_31 = Panel(digit_scroller_19)
digit_scroller_20 = DigitScroller(Scroller_Digits=12, Scroller_Prefix="Digit Scroller", Scroller_Radix=1, Scroller_Value=7.7777e-05)
digit_scroller_21 = DigitScroller(Scroller_Digits=12, Scroller_Prefix="Digit Scroller", Scroller_Radix=1, Scroller_Value=7.5243e-06)
digit_scroller_22 = DigitScroller(Scroller_Digits=12, Scroller_Prefix="Digit Scroller", Scroller_Radix=1, Scroller_Value=7.7777e-05)
digit_scroller_23 = DigitScroller(Scroller_Digits=12, Scroller_Prefix="Digit Scroller", Scroller_Radix=1, Scroller_Value=7.5243e-06)
digit_scroller_24 = DigitScroller(Scroller_Digits=12, Scroller_Prefix="Digit Scroller", Scroller_Radix=1, Scroller_Value=7.7777e-05)

digit_scroller_25 = DigitScroller(Scroller_Digits=12, Scroller_Prefix=" ", Scroller_Radix=2, Scroller_Value=16)
number = Number(digit_scroller_25)

digit_scroller_26 = DigitScroller(Scroller_Digits=12, Scroller_Prefix="Digit Scroller", Scroller_Radix=1, Scroller_Value=7.5243e-06)
digit_scroller_27 = DigitScroller(Scroller_Digits=12, Scroller_Prefix="Digit Scroller", Scroller_Radix=1, Scroller_Value=7.7777e-05)
digit_scroller_28 = DigitScroller(Scroller_Digits=12, Scroller_Prefix="Digit Scroller", Scroller_Radix=1, Scroller_Value=7.5243e-06)
digit_scroller_29 = DigitScroller(Scroller_Digits=12, Scroller_Prefix="Digit Scroller", Scroller_Radix=1, Scroller_Value=7.7777e-05)
digit_scroller_30 = DigitScroller(Scroller_Digits=12, Scroller_Prefix=" ", Scroller_Radix=2, Scroller_Value=0)
digit_scroller_31 = DigitScroller(Scroller_Digits=12, Scroller_Prefix="Digit Scroller", Scroller_Radix=1, Scroller_Value=0.02196259374)
panel_43 = Panel(digit_scroller_31)
digit_scroller_32 = DigitScroller(Scroller_Digits=12, Scroller_Prefix="Digit Scroller", Scroller_Radix=1, Scroller_Value=7.7777e-05)

digit_scroller_33 = DigitScroller(Scroller_Digits=12, Scroller_Prefix=" ", Scroller_Radix=2, Scroller_Value=0)
digit_scroller_34 = DigitScroller(Scroller_Digits=12, Scroller_Prefix=" ", Scroller_Radix=2, Scroller_Value=30.9312132)
panel_44 = Panel("16.93121320041889709")
curve_2 = Curve(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)
curve_3 = Curve(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)

digit_scroller_35 = DigitScroller(Scroller_Digits=12, Scroller_Prefix="Digit Scroller", Scroller_Radix=5, Scroller_Value=20817.02838)

digit_scroller_36 = DigitScroller(Scroller_Digits=12, Scroller_Prefix="Digit Scroller", Scroller_Radix=4, Scroller_Value=2233.523438)

digit_scroller_37 = DigitScroller(Scroller_Digits=12, Scroller_Prefix="Digit Scroller", Scroller_Radix=4, Scroller_Value=281.0810667)
line_sdl = LineSDL(Start=Point(-2.121093912, 1.99985794, 0), Direction=Vector(0.0625, 0.0625, 0), Length=1)

digit_scroller_38 = DigitScroller(Scroller_Digits=12, Scroller_Prefix="Digit Scroller", Scroller_Radix=3, Scroller_Value=0.0689)
line_sdl_2 = LineSDL(Start=Point(0, 0, 0), Direction=Vector(1, 0, 0), Length=1)

digit_scroller_39 = DigitScroller(Scroller_Digits=12, Scroller_Prefix="Digit Scroller", Scroller_Radix=6, Scroller_Value=383463.9766)

digit_scroller_40 = DigitScroller(Scroller_Digits=12, Scroller_Prefix="Digit Scroller", Scroller_Radix=3, Scroller_Value=4.392015)

digit_scroller_41 = DigitScroller(Scroller_Digits=12, Scroller_Prefix="Digit Scroller", Scroller_Radix=5, Scroller_Value=56336.19681)

digit_scroller_42 = DigitScroller(Scroller_Digits=12, Scroller_Prefix="Digit Scroller", Scroller_Radix=6, Scroller_Value=271915.0063)

digit_scroller_43 = DigitScroller(Scroller_Digits=12, Scroller_Prefix="Digit Scroller", Scroller_Radix=7, Scroller_Value=2183007.899)

panel_45 = Panel("""0    256    0.0013733120705119695
0    4096    0.0000053644183496292""")
digit_scroller_44 = DigitScroller(Scroller_Digits=12, Scroller_Prefix=" ", Scroller_Radix=11, Scroller_Value=64)
digit_scroller_45 = DigitScroller(Scroller_Digits=12, Scroller_Prefix="Digit Scroller", Scroller_Radix=1, Scroller_Value=7.49e-08)
digit_scroller_46 = DigitScroller(Scroller_Digits=12, Scroller_Prefix="Digit Scroller", Scroller_Radix=1, Scroller_Value=5.243e-07)

create_material = CreateMaterial(Diffuse=RGB(191, 191, 191), Specular=RGB(0, 255, 255), Emission=RGB(0, 0, 0), Transparency=0.5, Shine=100)

create_material_2 = CreateMaterial(Diffuse=RGB(217, 217, 217), Specular=RGB(0, 255, 255), Emission=RGB(0, 0, 0), Transparency=0.5, Shine=100)

create_material_3 = CreateMaterial(Diffuse=RGB(199, 199, 199), Specular=RGB(0, 255, 255), Emission=RGB(0, 0, 0), Transparency=0.5, Shine=100)

create_material_4 = CreateMaterial(Diffuse=RGB(224, 224, 224), Specular=RGB(0, 255, 255), Emission=RGB(0, 0, 0), Transparency=0.5, Shine=100)

create_material_5 = CreateMaterial(Diffuse=RGB(207, 207, 207), Specular=RGB(0, 255, 255), Emission=RGB(0, 0, 0), Transparency=0.5, Shine=100)

create_material_6 = CreateMaterial(Diffuse=RGB(232, 232, 232), Specular=RGB(0, 255, 255), Emission=RGB(0, 0, 0), Transparency=0.5, Shine=100)

create_material_7 = CreateMaterial(Diffuse=RGB(214, 214, 214), Specular=RGB(0, 255, 255), Emission=RGB(0, 0, 0), Transparency=0.5, Shine=100)

create_material_8 = CreateMaterial(Diffuse=RGB(240, 240, 240), Specular=RGB(0, 255, 255), Emission=RGB(0, 0, 0), Transparency=0.5, Shine=100)

create_material_9 = CreateMaterial(Diffuse=RGB(222, 222, 222), Specular=RGB(0, 255, 255), Emission=RGB(0, 0, 0), Transparency=0.5, Shine=100)

create_material_10 = CreateMaterial(Diffuse=RGB(247, 247, 247), Specular=RGB(0, 255, 255), Emission=RGB(0, 0, 0), Transparency=0.5, Shine=100)

create_material_11 = CreateMaterial(Diffuse=RGB(161, 161, 161), Specular=RGB(0, 255, 255), Emission=RGB(0, 0, 0), Transparency=0.5, Shine=100)

create_material_12 = CreateMaterial(Diffuse=RGB(186, 186, 186), Specular=RGB(0, 255, 255), Emission=RGB(0, 0, 0), Transparency=0.5, Shine=100)

create_material_13 = CreateMaterial(Diffuse=RGB(168, 168, 168), Specular=RGB(0, 255, 255), Emission=RGB(0, 0, 0), Transparency=0.5, Shine=100)

create_material_14 = CreateMaterial(Diffuse=RGB(194, 194, 194), Specular=RGB(0, 255, 255), Emission=RGB(0, 0, 0), Transparency=0.5, Shine=100)

create_material_15 = CreateMaterial(Diffuse=RGB(184, 184, 184), Specular=RGB(0, 255, 255), Emission=RGB(0, 0, 0), Transparency=0.5, Shine=100)

create_material_16 = CreateMaterial(Diffuse=RGB(209, 209, 209), Specular=RGB(0, 255, 255), Emission=RGB(0, 0, 0), Transparency=0.5, Shine=100)

create_material_17 = CreateMaterial(Diffuse=RGB(176, 176, 176), Specular=RGB(0, 255, 255), Emission=RGB(0, 0, 0), Transparency=0.5, Shine=100)

create_material_18 = CreateMaterial(Diffuse=RGB(201, 201, 201), Specular=RGB(0, 255, 255), Emission=RGB(0, 0, 0), Transparency=0.5, Shine=100)

digit_scroller_47 = DigitScroller(Scroller_Digits=12, Scroller_Prefix=" ", Scroller_Radix=7, Scroller_Value=16)

panel_46 = Panel("0.35721403168191375/4/4")
panel_47 = Panel("""1    16    0.35721403168191375
1    256    0.0014014999884235925
1    4096    """)
digit_scroller_48 = DigitScroller(Scroller_Digits=12, Scroller_Prefix="Digit Scroller", Scroller_Radix=1, Scroller_Value=0.00140149998)
radians = Radians(Degrees="0.001373312102167")
number_slider = Slider(256, range=0..65536)

panel_48 = Panel("0.0013733120705119695*4*4")

expression = Expression(O=radians, Expression="FORMAT(\"{0:0.00000000000000000000}\",O)")
panel_49 = Panel(expression)
curve_4 = Curve(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)

digit_scroller_49 = DigitScroller(Scroller_Digits=12, Scroller_Prefix=" ", Scroller_Radix=7, Scroller_Value=16)

vector_xyz = VectorXYZ(XComponent=0, YComponent=4, ZComponent=0)  # -> Vector, Length

number_slider_2 = Slider(1, range=0..1)

digit_scroller_50 = DigitScroller(Scroller_Digits=12, Scroller_Prefix=" ", Scroller_Radix=2, Scroller_Value=0)
panel_50 = Panel("30.93121320041889709")
curve_5 = Curve(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)
curve_6 = Curve(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)

digit_scroller_51 = DigitScroller(Scroller_Digits=12, Scroller_Prefix=" ", Scroller_Radix=2, Scroller_Value=0)
digit_scroller_52 = DigitScroller(Scroller_Digits=12, Scroller_Prefix=" ", Scroller_Radix=2, Scroller_Value=30.9312132)
curve_7 = Curve(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)
curve_8 = Curve(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)

digit_scroller_53 = DigitScroller(Scroller_Digits=12, Scroller_Prefix="Digit Scroller", Scroller_Radix=1, Scroller_Value=0.00140149998)
number_slider_3 = Slider(256, range=0..65536)

digit_scroller_54 = DigitScroller(Scroller_Digits=12, Scroller_Prefix=" ", Scroller_Radix=4, Scroller_Value=1179.13)

digit_scroller_55 = DigitScroller(Scroller_Digits=12, Scroller_Prefix=" ", Scroller_Radix=1, Scroller_Value=0.04375)

digit_scroller_56 = DigitScroller(Scroller_Digits=12, Scroller_Prefix=" ", Scroller_Radix=6, Scroller_Value=0.75)

digit_scroller_57 = DigitScroller(Scroller_Digits=12, Scroller_Prefix=" ", Scroller_Radix=11, Scroller_Value=256)
digit_scroller_58 = DigitScroller(Scroller_Digits=12, Scroller_Prefix=" ", Scroller_Radix=11, Scroller_Value=87)
create_material_19 = CreateMaterial(Diffuse=RGB(222, 222, 222), Specular=RGB(0, 255, 255), Emission=RGB(0, 0, 0), Transparency=0.5, Shine=100)
create_material_20 = CreateMaterial(Diffuse=RGB(247, 247, 247), Specular=RGB(0, 255, 255), Emission=RGB(0, 0, 0), Transparency=0.5, Shine=100)
create_material_21 = CreateMaterial(Diffuse=RGB(176, 176, 176), Specular=RGB(0, 255, 255), Emission=RGB(0, 0, 0), Transparency=0.5, Shine=100)

digit_scroller_59 = DigitScroller(Scroller_Digits=12, Scroller_Prefix=" ", Scroller_Radix=2, Scroller_Value=0.024609375)

digit_scroller_60 = DigitScroller(Scroller_Digits=12, Scroller_Prefix=" ", Scroller_Radix=1, Scroller_Value=0.0328125)

digit_scroller_61 = DigitScroller(Scroller_Digits=12, Scroller_Prefix="Digit Scroller", Scroller_Radix=1, Scroller_Value=0.00140149998)
radians_2 = Radians(Degrees="0.001373312102167")
number_slider_4 = Slider(256, range=0..65536)

create_material_22 = CreateMaterial(Diffuse=RGB(207, 207, 207), Specular=RGB(0, 255, 255), Emission=RGB(0, 0, 0), Transparency=0.5, Shine=100)
create_material_23 = CreateMaterial(Diffuse=RGB(232, 232, 232), Specular=RGB(0, 255, 255), Emission=RGB(0, 0, 0), Transparency=0.5, Shine=100)
create_material_24 = CreateMaterial(Diffuse=RGB(214, 214, 214), Specular=RGB(0, 255, 255), Emission=RGB(0, 0, 0), Transparency=0.5, Shine=100)
create_material_25 = CreateMaterial(Diffuse=RGB(240, 240, 240), Specular=RGB(0, 255, 255), Emission=RGB(0, 0, 0), Transparency=0.5, Shine=100)

create_material_26 = CreateMaterial(Diffuse=RGB(161, 161, 161), Specular=RGB(0, 255, 255), Emission=RGB(0, 0, 0), Transparency=0.5, Shine=100)
create_material_27 = CreateMaterial(Diffuse=RGB(186, 186, 186), Specular=RGB(0, 255, 255), Emission=RGB(0, 0, 0), Transparency=0.5, Shine=100)

create_material_28 = CreateMaterial(Diffuse=RGB(168, 168, 168), Specular=RGB(0, 255, 255), Emission=RGB(0, 0, 0), Transparency=0.5, Shine=100)
create_material_29 = CreateMaterial(Diffuse=RGB(194, 194, 194), Specular=RGB(0, 255, 255), Emission=RGB(0, 0, 0), Transparency=0.5, Shine=100)

create_material_30 = CreateMaterial(Diffuse=RGB(176, 176, 176), Specular=RGB(0, 255, 255), Emission=RGB(0, 0, 0), Transparency=0.5, Shine=100)
create_material_31 = CreateMaterial(Diffuse=RGB(201, 201, 201), Specular=RGB(0, 255, 255), Emission=RGB(0, 0, 0), Transparency=0.5, Shine=100)

expression_2 = Expression(O=radians_2, Expression="FORMAT(\"{0:0.00000000000000000000}\",O)")
panel_57 = Panel(expression_2)
curve_9 = Curve(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)

create_material_32 = CreateMaterial(Diffuse=RGB(184, 184, 184), Specular=RGB(0, 255, 255), Emission=RGB(0, 0, 0), Transparency=0.5, Shine=100)
create_material_33 = CreateMaterial(Diffuse=RGB(209, 209, 209), Specular=RGB(0, 255, 255), Emission=RGB(0, 0, 0), Transparency=0.5, Shine=100)

create_material_34 = CreateMaterial(Diffuse=RGB(191, 191, 191), Specular=RGB(0, 255, 255), Emission=RGB(0, 0, 0), Transparency=0.5, Shine=100)
create_material_35 = CreateMaterial(Diffuse=RGB(217, 217, 217), Specular=RGB(0, 255, 255), Emission=RGB(0, 0, 0), Transparency=0.5, Shine=100)

create_material_36 = CreateMaterial(Diffuse=RGB(199, 199, 199), Specular=RGB(0, 255, 255), Emission=RGB(0, 0, 0), Transparency=0.5, Shine=100)
create_material_37 = CreateMaterial(Diffuse=RGB(224, 224, 224), Specular=RGB(0, 255, 255), Emission=RGB(0, 0, 0), Transparency=0.5, Shine=100)

create_material_38 = CreateMaterial(Diffuse=RGB(207, 207, 207), Specular=RGB(0, 255, 255), Emission=RGB(0, 0, 0), Transparency=0.5, Shine=100)
create_material_39 = CreateMaterial(Diffuse=RGB(232, 232, 232), Specular=RGB(0, 255, 255), Emission=RGB(0, 0, 0), Transparency=0.5, Shine=100)

digit_scroller_62 = DigitScroller(Scroller_Digits=12, Scroller_Prefix=" ", Scroller_Radix=7, Scroller_Value=16)

number_slider_5 = Slider(1, range=0..1)

curve_10 = Curve(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)

digit_scroller_63 = DigitScroller(Scroller_Digits=12, Scroller_Prefix=" ", Scroller_Radix=7, Scroller_Value=16)

vector_xyz_2 = VectorXYZ(XComponent=2.5, YComponent=4, ZComponent=0)  # -> Vector, Length

number_slider_6 = Slider(1, range=0..1)

digit_scroller_64 = DigitScroller(Scroller_Digits=12, Scroller_Prefix=" ", Scroller_Radix=2, Scroller_Value=0)
curve_11 = Curve(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)
curve_12 = Curve(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)

digit_scroller_65 = DigitScroller(Scroller_Digits=12, Scroller_Prefix=" ", Scroller_Radix=2, Scroller_Value=0)
digit_scroller_66 = DigitScroller(Scroller_Digits=12, Scroller_Prefix=" ", Scroller_Radix=2, Scroller_Value=30.9312132)
curve_13 = Curve(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)
curve_14 = Curve(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)

digit_scroller_67 = DigitScroller(Scroller_Digits=12, Scroller_Prefix="Digit Scroller", Scroller_Radix=1, Scroller_Value=0.00140149998)
number_slider_7 = Slider(256, range=0..65536)

digit_scroller_68 = DigitScroller(Scroller_Digits=12, Scroller_Prefix="Digit Scroller", Scroller_Radix=1, Scroller_Value=0.00140149998)
radians_3 = Radians(Degrees="0.001373312102167")
number_slider_8 = Slider(256, range=0..65536)

expression_3 = Expression(O=radians_3, Expression="FORMAT(\"{0:0.00000000000000000000}\",O)")
panel_65 = Panel(expression_3)
curve_15 = Curve(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)

digit_scroller_69 = DigitScroller(Scroller_Digits=12, Scroller_Prefix=" ", Scroller_Radix=7, Scroller_Value=16)

digit_scroller_70 = DigitScroller(Scroller_Digits=12, Scroller_Prefix=" ", Scroller_Radix=7, Scroller_Value=16)

number_slider_9 = Slider(1, range=0..1)

vector_xyz_3 = VectorXYZ(XComponent=5, YComponent=4, ZComponent=0)  # -> Vector, Length

number_slider_10 = Slider(1, range=0..1)

curve_16 = Curve(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)

vector_xyz_4 = VectorXYZ(XComponent=5, YComponent=1.5, ZComponent=0)  # -> Vector, Length

digit_scroller_71 = DigitScroller(Scroller_Digits=12, Scroller_Prefix=" ", Scroller_Radix=2, Scroller_Value=0)
curve_17 = Curve(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)
curve_18 = Curve(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)

digit_scroller_72 = DigitScroller(Scroller_Digits=12, Scroller_Prefix=" ", Scroller_Radix=2, Scroller_Value=0)
digit_scroller_73 = DigitScroller(Scroller_Digits=12, Scroller_Prefix=" ", Scroller_Radix=2, Scroller_Value=30.9312132)
curve_19 = Curve(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)
curve_20 = Curve(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)

digit_scroller_74 = DigitScroller(Scroller_Digits=12, Scroller_Prefix="Digit Scroller", Scroller_Radix=1, Scroller_Value=0.00140149998)
number_slider_11 = Slider(256, range=0..65536)

digit_scroller_75 = DigitScroller(Scroller_Digits=12, Scroller_Prefix="Digit Scroller", Scroller_Radix=1, Scroller_Value=0.00140149998)
radians_4 = Radians(Degrees="0.001373312102167")
number_slider_12 = Slider(256, range=0..65536)

expression_4 = Expression(O=radians_4, Expression="FORMAT(\"{0:0.00000000000000000000}\",O)")
panel_73 = Panel(expression_4)
curve_21 = Curve(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)

digit_scroller_76 = DigitScroller(Scroller_Digits=12, Scroller_Prefix=" ", Scroller_Radix=7, Scroller_Value=16)

number_slider_13 = Slider(1, range=0..1)

digit_scroller_77 = DigitScroller(Scroller_Digits=12, Scroller_Prefix=" ", Scroller_Radix=7, Scroller_Value=16)

vector_xyz_5 = VectorXYZ(XComponent=7.5, YComponent=4, ZComponent=0)  # -> Vector, Length

curve_22 = Curve(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)

number_slider_14 = Slider(1, range=0..1)

digit_scroller_78 = DigitScroller(Scroller_Digits=12, Scroller_Prefix="Digit Scroller", Scroller_Radix=11, Scroller_Value=16)  # disabled
construct_point = ConstructPoint(XCoordinate=0.5, YCoordinate=0.5, ZCoordinate=0)  # -> flatten(Point); disabled
line_sdl_3 = LineSDL(Start=Point(0, 0, 0), Direction=Vector(1, 0, 0), Length=expr("X/2", 1))  # disabled
button = Button()  # disabled
file_path = FilePath("C:\IICSA.O__4201_EDIWID_1_TNEMERCNI__TNEIDARG_PUKOOL_ROLOC_HTOMS_3_DIOMGIS_ERUTAWRUC_RAENIL_DEPAM_4_NOITISNART_EGDE_LUF_EKUN__O__NUKE_FUL_EDGE_TRANSITION_4_MAPED_LINEAR_CURWATURE_SIGMOID_3_SMOTH_COLOR_LOOKUP_GRADIENT__INCREMENT_1_DIWIDE_1024__O.ASCII")  # disabled
number_2 = Number(digit_scroller_78)  # disabled

vector_xyz_6 = VectorXYZ(XComponent=7.5, YComponent=1.5, ZComponent=0)  # -> Vector, Length

button_2 = Button()  # disabled
file_path_2 = FilePath("C:\VSC.O____STNEMGES_4201____HTOMS_LEVEL_3_DIOMGIS_ERUTAWRUC_RAENIL_DEPAM_SEMIT_4_NOITISNART_EGDE_LUF____O____FUL_EDGE_TRANSITION_4_TIMES_MAPED_LINEAR_CURWATURE_SIGMOID_3_LEVEL_SMOTH____1024_SEGMENTS____O.CSV")  # disabled

digit_scroller_79 = DigitScroller(Scroller_Digits=12, Scroller_Prefix=" ", Scroller_Radix=2, Scroller_Value=30.9312132)
digit_scroller_80 = DigitScroller(Scroller_Digits=12, Scroller_Prefix=" ", Scroller_Radix=2, Scroller_Value=0)
curve_23 = Curve(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)
curve_24 = Curve(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)

digit_scroller_81 = DigitScroller(Scroller_Digits=12, Scroller_Prefix=" ", Scroller_Radix=2, Scroller_Value=0)
curve_25 = Curve(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)
curve_26 = Curve(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)

digit_scroller_82 = DigitScroller(Scroller_Digits=12, Scroller_Prefix="Digit Scroller", Scroller_Radix=1, Scroller_Value=0.00140149998)
radians_5 = Radians(Degrees="0.001373312102167")
number_slider_15 = Slider(256, range=0..65536)

digit_scroller_83 = DigitScroller(Scroller_Digits=12, Scroller_Prefix="Digit Scroller", Scroller_Radix=1, Scroller_Value=0.00140149998)
number_slider_16 = Slider(256, range=0..65536)

expression_5 = Expression(O=radians_5, Expression="FORMAT(\"{0:0.00000000000000000000}\",O)")
panel_81 = Panel(expression_5)
curve_27 = Curve(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)

digit_scroller_84 = DigitScroller(Scroller_Digits=12, Scroller_Prefix=" ", Scroller_Radix=7, Scroller_Value=16)

vector_xyz_7 = VectorXYZ(XComponent=10, YComponent=4, ZComponent=0)  # -> Vector, Length

digit_scroller_85 = DigitScroller(Scroller_Digits=12, Scroller_Prefix=" ", Scroller_Radix=7, Scroller_Value=16)

number_slider_17 = Slider(1, range=0..1)

number_slider_18 = Slider(1, range=0..1)

curve_28 = Curve(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)

number_slider_19 = Slider(0, range=0..1)  # disabled
button_3 = Button()  # disabled
file_path_3 = FilePath("C:\VSC.O____EPAHS_LANGIS____STNEMGES_4201____HTOMS_LEVEL_3_DIOMGIS_ERUTAWRUC_RAENIL_DEPAM_SEMIT_4_NOITISNART_EGDE_LUF____O____FUL_EDGE_TRANSITION_4_TIMES_MAPED_LINEAR_CURWATURE_SIGMOID_3_LEVEL_SMOTH____1024_SEGMENTS____SIGNAL_SHAPE____O.CSV")  # disabled

vector_xyz_8 = VectorXYZ(XComponent=10, YComponent=1.5, ZComponent=0)  # -> Vector, Length

digit_scroller_86 = DigitScroller(Scroller_Digits=12, Scroller_Prefix=" ", Scroller_Radix=2, Scroller_Value=0)
curve_29 = Curve(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)
curve_30 = Curve(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)

digit_scroller_87 = DigitScroller(Scroller_Digits=12, Scroller_Prefix="Digit Scroller", Scroller_Radix=1, Scroller_Value=0.00140149998)
number_slider_20 = Slider(256, range=0..65536)

digit_scroller_88 = DigitScroller(Scroller_Digits=12, Scroller_Prefix=" ", Scroller_Radix=7, Scroller_Value=16)

number_slider_21 = Slider(1, range=0..1)

curve_31 = Curve(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)

vector_xyz_9 = VectorXYZ(XComponent=12.5, YComponent=1.5, ZComponent=0)  # -> Vector, Length

digit_scroller_89 = DigitScroller(Scroller_Digits=12, Scroller_Prefix=" ", Scroller_Radix=1, Scroller_Value=3.243e-07)
digit_scroller_90 = DigitScroller(Scroller_Digits=12, Scroller_Prefix=" ", Scroller_Radix=11, Scroller_Value=256)
number_slider_22 = Slider(1, range=0..1)
number_slider_23 = Slider(1, range=0..1)
number_3 = Number(digit_scroller_89)

number_4 = Number(digit_scroller_90)  # disabled

radians_6 = Radians(Degrees=number_3)

number_5 = Number(digit_scroller_90)

number_6 = Number(number_5)
number_7 = Number(number_5)
number_8 = Number(expr("X*4", number_7))

number_9 = Number(number_8)

divide_curve = DivideCurve(Curve=line_sdl_2, Count=number_9, Kinks=False)  # -> Points, Tangents, Parameters

series = Series(Start=0, Step=radians_6, Count=number_5)
expression_6 = Expression(X=number_5, Expression="1/X")
duplicate_data = DuplicateData(Data=expression_6, Number=number_5, Order=True)
turtle = DotNETVBScriptLEGACY(Forward=duplicate_data, Left=series)  # -> Output, Points; inputs Forward: list, Left: list
# ---------- turtle: VB ----------
    Dim i As Integer
    Dim dir As New On3dVector(1, 0, 0)    
    Dim pos As New On3dVector(0, 0, 0) 
    Dim axis As New On3dVector(0, 0, 1)
    Dim pnts As New List(Of On3dVector)

    pnts.Add(pos)
    
    For i = 0 To Forward.Count() - 1
      Dim P As New On3dVector
      dir.Rotate(Left(i), axis)      
      P = dir * Forward(i) + pnts(i)
      pnts.Add(P)
    Next
    
    Points = pnts
# ---------- end turtle ----------
point = Point(turtle.Points)

scale = Scale(Geometry=point, Center=Point(0, 0, 0), Factor=expr("2^X", digit_scroller_47))  # -> Geometry, Transform

interpolate_t = InterpolateT(Vertices=scale.Geometry, TangentStart=Vector(0.0625, 0, 0), TangentEnd=Vector(0, 0, 0), KnotStyle=2)  # -> Curve, Length, Domain
evaluate_length = EvaluateLength(Curve=interpolate_t.Curve, Length=1, Normalized=True)  # -> Point, Tangent, Parameter
line_sdl_4 = LineSDL(Start=evaluate_length.Point, Direction=evaluate_length.Tangent, Length=1)
mirror = Mirror(Geometry=interpolate_t.Curve, Plane=line_sdl_4)  # -> Geometry, Transform
join_curves = JoinCurves(Curves=[interpolate_t.Curve, mirror.Geometry], Preserve=False)
evaluate_length_2 = EvaluateLength(Curve=join_curves, Length=1, Normalized=True)  # -> Point, Tangent, Parameter
rotate = Rotate(Geometry=join_curves, Angle=3.141592654, Plane=evaluate_length_2.Point)  # -> Geometry, Transform
join_curves_2 = JoinCurves(Curves=[join_curves, rotate.Geometry], Preserve=False)
curve_32 = Curve(join_curves_2)

expression_7 = Expression(O=turtle.Points, Expression="FORMAT(\"{0:R}\",O)")
expression_8 = Expression(O=series, Expression="FORMAT(\"{0:R}\",O)")
panel_86 = Panel(expression_8)
evaluate_length_3 = EvaluateLength(Curve=join_curves_2, Length=1, Normalized=True)  # -> Point, Tangent, Parameter
deconstruct = Deconstruct(Point=evaluate_length_3.Point)  # -> XComponent, YComponent, ZComponent
expression_9 = Expression(O=deconstruct.YComponent, Expression="FORMAT(\"{0:R}\",O)")
expression_10 = Expression(O=deconstruct.XComponent, Expression="FORMAT(\"{0:R}\",O)")
expression_11 = Expression(O=deconstruct.ZComponent, Expression="FORMAT(\"{0:R}\",O)")
panel_87 = Panel(expression_9)
panel_88 = Panel(expression_10)
panel_89 = Panel(expression_11)
addition = Addition(A=panel_87, B=panel_88)
expression_12 = Expression(O=addition, Expression="FORMAT(\"{0:R}\",O)")
panel_90 = Panel(expression_12)
division = Division(A=panel_90, B=2)
expression_13 = Expression(O=division, Expression="FORMAT(\"{0:R}\",O)")
panel_91 = Panel(expression_13)
scale_2 = Scale(Geometry=curve_32, Center=Point(0, 0, 0), Factor=expr("1/X", panel_91))  # -> Geometry, Transform
evaluate_length_4 = EvaluateLength(Curve=scale_2.Geometry, Length=1, Normalized=True)  # -> Point, Tangent, Parameter
deconstruct_2 = Deconstruct(Point=evaluate_length_4.Point)  # -> XComponent, YComponent, ZComponent
expression_14 = Expression(O=deconstruct_2.XComponent, Expression="FORMAT(\"{0:R}\",O)")
expression_15 = Expression(O=deconstruct_2.ZComponent, Expression="FORMAT(\"{0:R}\",O)")
expression_16 = Expression(O=deconstruct_2.YComponent, Expression="FORMAT(\"{0:R}\",O)")
panel_92 = Panel(expression_15)
panel_93 = Panel(expression_16)
panel_94 = Panel(expression_14)
division_2 = Division(A=panel_88, B=panel_87)
expression_17 = Expression(O=division_2, Expression="FORMAT(\"{0:R}\",O)")
panel_95 = Panel(expression_17)
curve_33 = Curve(scale_2.Geometry)

panel_97 = Panel(expression_7)

move = Move(Geometry=curve_33, Motion=Vector(0, 0, 0))  # -> Geometry, Transform
curve_34 = Curve(move.Geometry)  # disabled

curve_35 = Curve(curve_33)
end_points = EndPoints(Curve=curve_35)  # -> Start, End
rectangle_2pt = Rectangle2Pt(Plane=PlaneXY(0, 0, 0), PointA=end_points.Start, PointB=end_points.End, Radius=0)  # -> Rectangle, Length
deconstuct_rectangle = DeconstuctRectangle(Rectangle=rectangle_2pt.Rectangle)  # -> BasePlane, XInterval, YInterval
deconstruct_domain = DeconstructDomain(Domain=deconstuct_rectangle.YInterval)  # -> Start, End
deconstruct_domain_2 = DeconstructDomain(Domain=deconstuct_rectangle.XInterval)  # -> Start, End
scale_nu = ScaleNU(
    Geometry=curve_33,
    Plane=PlaneXY(0, 0, 0),
    ScaleX=expr("1/X", deconstruct_domain_2.End),
    ScaleY=expr("1/X", deconstruct_domain.End),
    ScaleZ=1)  # -> Geometry, Transform
curve_36 = Curve(scale_nu.Geometry)

stream_filter = StreamFilter(Gate=number_slider_22, Stream0=curve_33, Stream1=curve_36)
curve_37 = Curve(stream_filter)
scale_3 = Scale(Geometry=curve_37, Center=Point(0, 0, 0), Factor=expr("2^X", number))  # -> Geometry, Transform
curve_38 = Curve(scale_3.Geometry)

move_2 = Move(Geometry=curve_36, Motion=Vector(0, 1.5, 0))  # -> Geometry, Transform
curve_39 = Curve(move_2.Geometry)  # disabled

stream_filter_2 = StreamFilter(Gate=number_slider_22, Stream0=curve_33, Stream1=curve_36)
curve_40 = Curve(stream_filter_2)
scale_4 = Scale(Geometry=curve_40, Center=Point(0, 0, 0), Factor=expr("2^X", number))  # -> Geometry, Transform
curve_41 = Curve(scale_4.Geometry)

end_points_2 = EndPoints(Curve=curve_38)  # -> Start, End
rectangle_2pt_2 = Rectangle2Pt(Plane=PlaneXY(0, 0, 0), PointA=end_points_2.Start, PointB=end_points_2.End, Radius=0)  # -> Rectangle, Length

number_10 = Number(number_5)

series_2 = Series(Start=0, Step=panel_49, Count=number_10)
expression_18 = Expression(O=series_2, Expression="FORMAT(\"{0:R}\",O)")  # disabled
panel_98 = Panel(expression_18)
bounds = Bounds(Numbers=series_2)
expression_19 = Expression(X=number_10, Expression="1/X")
duplicate_data_2 = DuplicateData(Data=expression_19, Number=number_10, Order=True)

curve_graph_mapper = CurveGraphMapper(Curves=curve_38, Rectangle=rectangle_2pt_2.Rectangle, Values=series_2, Flip=False, Snap=True, TextSize=0.015625)  # -> Mapped, GraphCurves, GraphPoints, ValueLines, ValuePoints, MappedLines, MappedPoints, Boundary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; disabled
graphmapper = GraphMapper(Curve=curve_38, Boundary=rectangle_2pt_2.Rectangle, Numbers=series_2, Input=bounds, Output=bounds, bobo=False)  # disabled
stream_filter_3 = StreamFilter(Gate=number_slider_23, Stream0=curve_graph_mapper.Mapped, Stream1=graphmapper)

turtle_2 = DotNETVBScriptLEGACY(Forward=duplicate_data_2, Left=stream_filter_3)  # -> Output, Points; inputs Forward: list, Left: list; same code as turtle

expression_20 = Expression(O=turtle_2.Points, Expression="FORMAT(\"{0:R}\",O)")
panel_99 = Panel(expression_20)

point_2 = Point(turtle_2.Points)
scale_5 = Scale(Geometry=point_2, Center=Point(0, 0, 0), Factor=expr("2^X", digit_scroller_49))  # -> Geometry, Transform

interpolate_t_2 = InterpolateT(Vertices=scale_5.Geometry, TangentStart=Vector(0.0625, 0, 0), TangentEnd=Vector(0, 0, 0), KnotStyle=2)  # -> Curve, Length, Domain
evaluate_length_5 = EvaluateLength(Curve=interpolate_t_2.Curve, Length=1, Normalized=True)  # -> Point, Tangent, Parameter
line_sdl_5 = LineSDL(Start=evaluate_length_5.Point, Direction=evaluate_length_5.Tangent, Length=1)
mirror_2 = Mirror(Geometry=interpolate_t_2.Curve, Plane=line_sdl_5)  # -> Geometry, Transform
join_curves_3 = JoinCurves(Curves=[interpolate_t_2.Curve, mirror_2.Geometry], Preserve=False)
evaluate_length_6 = EvaluateLength(Curve=join_curves_3, Length=1, Normalized=True)  # -> Point, Tangent, Parameter
rotate_2 = Rotate(Geometry=join_curves_3, Angle=3.141592654, Plane=evaluate_length_6.Point)  # -> Geometry, Transform
join_curves_4 = JoinCurves(Curves=[join_curves_3, rotate_2.Geometry], Preserve=False)
curve_42 = Curve(join_curves_4)

evaluate_length_7 = EvaluateLength(Curve=join_curves_4, Length=1, Normalized=True)  # -> Point, Tangent, Parameter
deconstruct_3 = Deconstruct(Point=evaluate_length_7.Point)  # -> XComponent, YComponent, ZComponent
expression_21 = Expression(O=deconstruct_3.YComponent, Expression="FORMAT(\"{0:R}\",O)")
expression_22 = Expression(O=deconstruct_3.XComponent, Expression="FORMAT(\"{0:R}\",O)")
expression_23 = Expression(O=deconstruct_3.ZComponent, Expression="FORMAT(\"{0:R}\",O)")
panel_100 = Panel(expression_21)
panel_101 = Panel(expression_22)
panel_102 = Panel(expression_23)
addition_2 = Addition(A=panel_100, B=panel_101)
expression_24 = Expression(O=addition_2, Expression="FORMAT(\"{0:R}\",O)")
panel_103 = Panel(expression_24)
division_3 = Division(A=panel_103, B=2)
expression_25 = Expression(O=division_3, Expression="FORMAT(\"{0:R}\",O)")
panel_104 = Panel(expression_25)
scale_6 = Scale(Geometry=scale_5.Geometry, Center=Point(0, 0, 0), Factor=expr("1/X", panel_104))  # -> Geometry, Transform
scale_7 = Scale(Geometry=curve_42, Center=Point(0, 0, 0), Factor=expr("1/X", panel_104))  # -> Geometry, Transform
evaluate_length_8 = EvaluateLength(Curve=scale_7.Geometry, Length=1, Normalized=True)  # -> Point, Tangent, Parameter
deconstruct_4 = Deconstruct(Point=evaluate_length_8.Point)  # -> XComponent, YComponent, ZComponent
expression_26 = Expression(O=deconstruct_4.YComponent, Expression="FORMAT(\"{0:R}\",O)")
expression_27 = Expression(O=deconstruct_4.XComponent, Expression="FORMAT(\"{0:R}\",O)")
expression_28 = Expression(O=deconstruct_4.ZComponent, Expression="FORMAT(\"{0:R}\",O)")
panel_105 = Panel(expression_26)
panel_106 = Panel(expression_27)
panel_107 = Panel(expression_28)
division_4 = Division(A=panel_101, B=panel_100)
expression_29 = Expression(O=division_4, Expression="FORMAT(\"{0:R}\",O)")
panel_108 = Panel(expression_29)
curve_43 = Curve(scale_7.Geometry)
point_3 = Point(scale_6.Geometry)

move_3 = Move(Geometry=curve_43, Motion=vector_xyz.Vector)  # -> Geometry, Transform
mirror_3 = Mirror(Geometry=curve_43, Plane=PlaneYZ(0, 0, 0))  # -> Geometry, Transform; disabled
curve_44 = Curve(move_3.Geometry)

radians_7 = Radians(Degrees=number_3)

expression_30 = Expression(O=radians_7, Expression="FORMAT(\"{0:0.00000000000000000000}\",O)")
panel_110 = Panel(expression_30)
number_11 = Number(number_5)

number_12 = Number(number_8)
number_13 = Number(number_12)

end_points_3 = EndPoints(Curve=curve_41)  # -> Start, End
rectangle_2pt_3 = Rectangle2Pt(Plane=PlaneXY(0, 0, 0), PointA=end_points_3.Start, PointB=end_points_3.End, Radius=0)  # -> Rectangle, Length

series_3 = Series(Start=0, Step=panel_110, Count=number_11)
expression_31 = Expression(O=series_3, Expression="FORMAT(\"{0:R}\",O)")  # disabled
panel_111 = Panel(expression_31)
bounds_2 = Bounds(Numbers=series_3)
expression_32 = Expression(X=number_11, Expression="1/X")
duplicate_data_3 = DuplicateData(Data=expression_32, Number=number_11, Order=True)

curve_graph_mapper_2 = CurveGraphMapper(Curves=curve_41, Rectangle=rectangle_2pt_3.Rectangle, Values=series_3, Flip=False, Snap=True, TextSize=0.015625)  # -> Mapped, GraphCurves, GraphPoints, ValueLines, ValuePoints, MappedLines, MappedPoints, Boundary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; disabled
graphmapper_2 = GraphMapper(Curve=curve_41, Boundary=rectangle_2pt_3.Rectangle, Numbers=series_3, Input=bounds_2, Output=bounds_2, bobo=True)
stream_filter_4 = StreamFilter(Gate=number_slider_23, Stream0=curve_graph_mapper_2.Mapped, Stream1=graphmapper_2)

turtle_3 = DotNETVBScriptLEGACY(Forward=duplicate_data_3, Left=stream_filter_4)  # -> Output, Points; inputs Forward: list, Left: list; same code as turtle

expression_33 = Expression(O=turtle_3.Points, Expression="FORMAT(\"{0:R}\",O)")
panel_112 = Panel(expression_33)

point_4 = Point(turtle_3.Points)
scale_8 = Scale(Geometry=point_4, Center=Point(0, 0, 0), Factor=expr("2^X", digit_scroller_62))  # -> Geometry, Transform

interpolate_t_3 = InterpolateT(Vertices=scale_8.Geometry, TangentStart=Vector(0.0625, 0, 0), TangentEnd=Vector(0, 0, 0), KnotStyle=2)  # -> Curve, Length, Domain
evaluate_length_9 = EvaluateLength(Curve=interpolate_t_3.Curve, Length=1, Normalized=True)  # -> Point, Tangent, Parameter
line_sdl_6 = LineSDL(Start=evaluate_length_9.Point, Direction=evaluate_length_9.Tangent, Length=1)
mirror_4 = Mirror(Geometry=interpolate_t_3.Curve, Plane=line_sdl_6)  # -> Geometry, Transform
join_curves_5 = JoinCurves(Curves=[interpolate_t_3.Curve, mirror_4.Geometry], Preserve=False)
evaluate_length_10 = EvaluateLength(Curve=join_curves_5, Length=1, Normalized=True)  # -> Point, Tangent, Parameter
rotate_3 = Rotate(Geometry=join_curves_5, Angle=3.141592654, Plane=evaluate_length_10.Point)  # -> Geometry, Transform
join_curves_6 = JoinCurves(Curves=[join_curves_5, rotate_3.Geometry], Preserve=False)
curve_45 = Curve(join_curves_6)

evaluate_length_11 = EvaluateLength(Curve=join_curves_6, Length=1, Normalized=True)  # -> Point, Tangent, Parameter
deconstruct_5 = Deconstruct(Point=evaluate_length_11.Point)  # -> XComponent, YComponent, ZComponent
expression_34 = Expression(O=deconstruct_5.YComponent, Expression="FORMAT(\"{0:R}\",O)")
expression_35 = Expression(O=deconstruct_5.XComponent, Expression="FORMAT(\"{0:R}\",O)")
expression_36 = Expression(O=deconstruct_5.ZComponent, Expression="FORMAT(\"{0:R}\",O)")
panel_113 = Panel(expression_34)
panel_114 = Panel(expression_35)
panel_115 = Panel(expression_36)
addition_3 = Addition(A=panel_113, B=panel_114)
expression_37 = Expression(O=addition_3, Expression="FORMAT(\"{0:R}\",O)")
panel_116 = Panel(expression_37)
division_5 = Division(A=panel_116, B=2)
expression_38 = Expression(O=division_5, Expression="FORMAT(\"{0:R}\",O)")
panel_117 = Panel(expression_38)
scale_9 = Scale(Geometry=scale_8.Geometry, Center=Point(0, 0, 0), Factor=expr("1/X", panel_117))  # -> Geometry, Transform
scale_10 = Scale(Geometry=curve_45, Center=Point(0, 0, 0), Factor=expr("1/X", panel_117))  # -> Geometry, Transform
evaluate_length_12 = EvaluateLength(Curve=scale_10.Geometry, Length=1, Normalized=True)  # -> Point, Tangent, Parameter
deconstruct_6 = Deconstruct(Point=evaluate_length_12.Point)  # -> XComponent, YComponent, ZComponent
expression_39 = Expression(O=deconstruct_6.YComponent, Expression="FORMAT(\"{0:R}\",O)")
expression_40 = Expression(O=deconstruct_6.XComponent, Expression="FORMAT(\"{0:R}\",O)")
expression_41 = Expression(O=deconstruct_6.ZComponent, Expression="FORMAT(\"{0:R}\",O)")
panel_118 = Panel(expression_39)
panel_119 = Panel(expression_40)
panel_120 = Panel(expression_41)
division_6 = Division(A=panel_114, B=panel_113)
expression_42 = Expression(O=division_6, Expression="FORMAT(\"{0:R}\",O)")
panel_121 = Panel(expression_42)
curve_46 = Curve(scale_10.Geometry)
point_5 = Point(scale_9.Geometry)

move_4 = Move(Geometry=curve_46, Motion=Vector(2.5, 0, 0))  # -> Geometry, Transform
mirror_5 = Mirror(Geometry=curve_46, Plane=PlaneYZ(0, 0, 0))  # -> Geometry, Transform; disabled
curve_47 = Curve(move_4.Geometry)  # disabled

curve_48 = Curve(curve_46)
end_points_4 = EndPoints(Curve=curve_48)  # -> Start, End
rectangle_2pt_4 = Rectangle2Pt(Plane=PlaneXY(0, 0, 0), PointA=end_points_4.Start, PointB=end_points_4.End, Radius=0)  # -> Rectangle, Length
deconstuct_rectangle_2 = DeconstuctRectangle(Rectangle=rectangle_2pt_4.Rectangle)  # -> BasePlane, XInterval, YInterval
deconstruct_domain_3 = DeconstructDomain(Domain=deconstuct_rectangle_2.YInterval)  # -> Start, End
deconstruct_domain_4 = DeconstructDomain(Domain=deconstuct_rectangle_2.XInterval)  # -> Start, End
scale_nu_2 = ScaleNU(
    Geometry=curve_46,
    Plane=PlaneXY(0, 0, 0),
    ScaleX=expr("1/X", deconstruct_domain_4.End),
    ScaleY=expr("1/X", deconstruct_domain_3.End),
    ScaleZ=1)  # -> Geometry, Transform
curve_49 = Curve(scale_nu_2.Geometry)
move_5 = Move(Geometry=curve_49, Motion=Vector(2.5, 1.5, 0))  # -> Geometry, Transform
curve_50 = Curve(move_5.Geometry)  # disabled

stream_filter_5 = StreamFilter(Gate=number_slider_22, Stream0=curve_46, Stream1=curve_49)
curve_51 = Curve(stream_filter_5)
scale_11 = Scale(Geometry=curve_51, Center=Point(0, 0, 0), Factor=expr("2^X", number))  # -> Geometry, Transform
curve_52 = Curve(scale_11.Geometry)

stream_filter_6 = StreamFilter(Gate=number_slider_22, Stream0=curve_46, Stream1=curve_49)
curve_53 = Curve(stream_filter_6)
scale_12 = Scale(Geometry=curve_53, Center=Point(0, 0, 0), Factor=expr("2^X", number))  # -> Geometry, Transform
curve_54 = Curve(scale_12.Geometry)

end_points_5 = EndPoints(Curve=curve_52)  # -> Start, End
rectangle_2pt_5 = Rectangle2Pt(Plane=PlaneXY(0, 0, 0), PointA=end_points_5.Start, PointB=end_points_5.End, Radius=0)  # -> Rectangle, Length

number_14 = Number(number_5)

series_4 = Series(Start=0, Step=panel_57, Count=number_14)
expression_43 = Expression(O=series_4, Expression="FORMAT(\"{0:R}\",O)")  # disabled
panel_123 = Panel(expression_43)
bounds_3 = Bounds(Numbers=series_4)
expression_44 = Expression(X=number_14, Expression="1/X")
duplicate_data_4 = DuplicateData(Data=expression_44, Number=number_14, Order=True)

curve_graph_mapper_3 = CurveGraphMapper(Curves=curve_52, Rectangle=rectangle_2pt_5.Rectangle, Values=series_4, Flip=False, Snap=True, TextSize=0.015625)  # -> Mapped, GraphCurves, GraphPoints, ValueLines, ValuePoints, MappedLines, MappedPoints, Boundary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; disabled
graphmapper_3 = GraphMapper(Curve=curve_52, Boundary=rectangle_2pt_5.Rectangle, Numbers=series_4, Input=bounds_3, Output=bounds_3, bobo=False)  # disabled
stream_filter_7 = StreamFilter(Gate=number_slider_23, Stream0=curve_graph_mapper_3.Mapped, Stream1=graphmapper_3)

turtle_4 = DotNETVBScriptLEGACY(Forward=duplicate_data_4, Left=stream_filter_7)  # -> Output, Points; inputs Forward: list, Left: list; same code as turtle

expression_45 = Expression(O=turtle_4.Points, Expression="FORMAT(\"{0:R}\",O)")
panel_124 = Panel(expression_45)

point_6 = Point(turtle_4.Points)
scale_13 = Scale(Geometry=point_6, Center=Point(0, 0, 0), Factor=expr("2^X", digit_scroller_63))  # -> Geometry, Transform

interpolate_t_4 = InterpolateT(Vertices=scale_13.Geometry, TangentStart=Vector(0.0625, 0, 0), TangentEnd=Vector(0, 0, 0), KnotStyle=2)  # -> Curve, Length, Domain
evaluate_length_13 = EvaluateLength(Curve=interpolate_t_4.Curve, Length=1, Normalized=True)  # -> Point, Tangent, Parameter
line_sdl_7 = LineSDL(Start=evaluate_length_13.Point, Direction=evaluate_length_13.Tangent, Length=1)
mirror_6 = Mirror(Geometry=interpolate_t_4.Curve, Plane=line_sdl_7)  # -> Geometry, Transform
join_curves_7 = JoinCurves(Curves=[interpolate_t_4.Curve, mirror_6.Geometry], Preserve=False)
evaluate_length_14 = EvaluateLength(Curve=join_curves_7, Length=1, Normalized=True)  # -> Point, Tangent, Parameter
rotate_4 = Rotate(Geometry=join_curves_7, Angle=3.141592654, Plane=evaluate_length_14.Point)  # -> Geometry, Transform
join_curves_8 = JoinCurves(Curves=[join_curves_7, rotate_4.Geometry], Preserve=False)
curve_55 = Curve(join_curves_8)

evaluate_length_15 = EvaluateLength(Curve=join_curves_8, Length=1, Normalized=True)  # -> Point, Tangent, Parameter
deconstruct_7 = Deconstruct(Point=evaluate_length_15.Point)  # -> XComponent, YComponent, ZComponent
expression_46 = Expression(O=deconstruct_7.YComponent, Expression="FORMAT(\"{0:R}\",O)")
expression_47 = Expression(O=deconstruct_7.XComponent, Expression="FORMAT(\"{0:R}\",O)")
expression_48 = Expression(O=deconstruct_7.ZComponent, Expression="FORMAT(\"{0:R}\",O)")
panel_125 = Panel(expression_46)
panel_126 = Panel(expression_47)
panel_127 = Panel(expression_48)
addition_4 = Addition(A=panel_125, B=panel_126)
expression_49 = Expression(O=addition_4, Expression="FORMAT(\"{0:R}\",O)")
panel_128 = Panel(expression_49)
division_7 = Division(A=panel_128, B=2)
expression_50 = Expression(O=division_7, Expression="FORMAT(\"{0:R}\",O)")
panel_129 = Panel(expression_50)
scale_14 = Scale(Geometry=scale_13.Geometry, Center=Point(0, 0, 0), Factor=expr("1/X", panel_129))  # -> Geometry, Transform
scale_15 = Scale(Geometry=curve_55, Center=Point(0, 0, 0), Factor=expr("1/X", panel_129))  # -> Geometry, Transform
evaluate_length_16 = EvaluateLength(Curve=scale_15.Geometry, Length=1, Normalized=True)  # -> Point, Tangent, Parameter
deconstruct_8 = Deconstruct(Point=evaluate_length_16.Point)  # -> XComponent, YComponent, ZComponent
expression_51 = Expression(O=deconstruct_8.YComponent, Expression="FORMAT(\"{0:R}\",O)")
expression_52 = Expression(O=deconstruct_8.XComponent, Expression="FORMAT(\"{0:R}\",O)")
expression_53 = Expression(O=deconstruct_8.ZComponent, Expression="FORMAT(\"{0:R}\",O)")
panel_130 = Panel(expression_51)
panel_131 = Panel(expression_52)
panel_132 = Panel(expression_53)
division_8 = Division(A=panel_126, B=panel_125)
expression_54 = Expression(O=division_8, Expression="FORMAT(\"{0:R}\",O)")
panel_133 = Panel(expression_54)
curve_56 = Curve(scale_15.Geometry)
point_7 = Point(scale_14.Geometry)

move_6 = Move(Geometry=curve_56, Motion=vector_xyz_2.Vector)  # -> Geometry, Transform
mirror_7 = Mirror(Geometry=curve_56, Plane=PlaneYZ(0, 0, 0))  # -> Geometry, Transform; disabled
curve_57 = Curve(move_6.Geometry)

radians_8 = Radians(Degrees=number_3)

expression_55 = Expression(O=radians_8, Expression="FORMAT(\"{0:0.00000000000000000000}\",O)")
panel_135 = Panel(expression_55)
number_15 = Number(number_5)

end_points_6 = EndPoints(Curve=curve_54)  # -> Start, End
rectangle_2pt_6 = Rectangle2Pt(Plane=PlaneXY(0, 0, 0), PointA=end_points_6.Start, PointB=end_points_6.End, Radius=0)  # -> Rectangle, Length

series_5 = Series(Start=0, Step=panel_135, Count=number_15)
expression_56 = Expression(O=series_5, Expression="FORMAT(\"{0:R}\",O)")  # disabled
panel_136 = Panel(expression_56)
bounds_4 = Bounds(Numbers=series_5)
expression_57 = Expression(X=number_15, Expression="1/X")
duplicate_data_5 = DuplicateData(Data=expression_57, Number=number_15, Order=True)

curve_graph_mapper_4 = CurveGraphMapper(Curves=curve_54, Rectangle=rectangle_2pt_6.Rectangle, Values=series_5, Flip=False, Snap=True, TextSize=0.015625)  # -> Mapped, GraphCurves, GraphPoints, ValueLines, ValuePoints, MappedLines, MappedPoints, Boundary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; disabled
graphmapper_4 = GraphMapper(Curve=curve_54, Boundary=rectangle_2pt_6.Rectangle, Numbers=series_5, Input=bounds_4, Output=bounds_4, bobo=True)
stream_filter_8 = StreamFilter(Gate=number_slider_23, Stream0=curve_graph_mapper_4.Mapped, Stream1=graphmapper_4)

turtle_5 = DotNETVBScriptLEGACY(Forward=duplicate_data_5, Left=stream_filter_8)  # -> Output, Points; inputs Forward: list, Left: list; same code as turtle

expression_58 = Expression(O=turtle_5.Points, Expression="FORMAT(\"{0:R}\",O)")
panel_137 = Panel(expression_58)

point_8 = Point(turtle_5.Points)
scale_16 = Scale(Geometry=point_8, Center=Point(0, 0, 0), Factor=expr("2^X", digit_scroller_69))  # -> Geometry, Transform

interpolate_t_5 = InterpolateT(Vertices=scale_16.Geometry, TangentStart=Vector(0.0625, 0, 0), TangentEnd=Vector(0, 0, 0), KnotStyle=2)  # -> Curve, Length, Domain
evaluate_length_17 = EvaluateLength(Curve=interpolate_t_5.Curve, Length=1, Normalized=True)  # -> Point, Tangent, Parameter
line_sdl_8 = LineSDL(Start=evaluate_length_17.Point, Direction=evaluate_length_17.Tangent, Length=1)
mirror_8 = Mirror(Geometry=interpolate_t_5.Curve, Plane=line_sdl_8)  # -> Geometry, Transform
join_curves_9 = JoinCurves(Curves=[interpolate_t_5.Curve, mirror_8.Geometry], Preserve=False)
evaluate_length_18 = EvaluateLength(Curve=join_curves_9, Length=1, Normalized=True)  # -> Point, Tangent, Parameter
rotate_5 = Rotate(Geometry=join_curves_9, Angle=3.141592654, Plane=evaluate_length_18.Point)  # -> Geometry, Transform
join_curves_10 = JoinCurves(Curves=[join_curves_9, rotate_5.Geometry], Preserve=False)
curve_58 = Curve(join_curves_10)

evaluate_length_19 = EvaluateLength(Curve=join_curves_10, Length=1, Normalized=True)  # -> Point, Tangent, Parameter
deconstruct_9 = Deconstruct(Point=evaluate_length_19.Point)  # -> XComponent, YComponent, ZComponent
expression_59 = Expression(O=deconstruct_9.YComponent, Expression="FORMAT(\"{0:R}\",O)")
expression_60 = Expression(O=deconstruct_9.XComponent, Expression="FORMAT(\"{0:R}\",O)")
expression_61 = Expression(O=deconstruct_9.ZComponent, Expression="FORMAT(\"{0:R}\",O)")
panel_138 = Panel(expression_59)
panel_139 = Panel(expression_60)
panel_140 = Panel(expression_61)
addition_5 = Addition(A=panel_138, B=panel_139)
expression_62 = Expression(O=addition_5, Expression="FORMAT(\"{0:R}\",O)")
panel_141 = Panel(expression_62)
division_9 = Division(A=panel_141, B=2)
expression_63 = Expression(O=division_9, Expression="FORMAT(\"{0:R}\",O)")
panel_142 = Panel(expression_63)
scale_17 = Scale(Geometry=scale_16.Geometry, Center=Point(0, 0, 0), Factor=expr("1/X", panel_142))  # -> Geometry, Transform
scale_18 = Scale(Geometry=curve_58, Center=Point(0, 0, 0), Factor=expr("1/X", panel_142))  # -> Geometry, Transform
evaluate_length_20 = EvaluateLength(Curve=scale_18.Geometry, Length=1, Normalized=True)  # -> Point, Tangent, Parameter
deconstruct_10 = Deconstruct(Point=evaluate_length_20.Point)  # -> XComponent, YComponent, ZComponent
expression_64 = Expression(O=deconstruct_10.YComponent, Expression="FORMAT(\"{0:R}\",O)")
expression_65 = Expression(O=deconstruct_10.XComponent, Expression="FORMAT(\"{0:R}\",O)")
expression_66 = Expression(O=deconstruct_10.ZComponent, Expression="FORMAT(\"{0:R}\",O)")
panel_143 = Panel(expression_64)
panel_144 = Panel(expression_65)
panel_145 = Panel(expression_66)
division_10 = Division(A=panel_139, B=panel_138)
expression_67 = Expression(O=division_10, Expression="FORMAT(\"{0:R}\",O)")
panel_146 = Panel(expression_67)
curve_59 = Curve(scale_18.Geometry)
point_9 = Point(scale_17.Geometry)

move_7 = Move(Geometry=curve_59, Motion=Vector(5, 0, 0))  # -> Geometry, Transform
mirror_9 = Mirror(Geometry=curve_59, Plane=PlaneYZ(0, 0, 0))  # -> Geometry, Transform; disabled
curve_60 = Curve(move_7.Geometry)  # disabled

curve_61 = Curve(curve_59)
end_points_7 = EndPoints(Curve=curve_61)  # -> Start, End
rectangle_2pt_7 = Rectangle2Pt(Plane=PlaneXY(0, 0, 0), PointA=end_points_7.Start, PointB=end_points_7.End, Radius=0)  # -> Rectangle, Length
deconstuct_rectangle_3 = DeconstuctRectangle(Rectangle=rectangle_2pt_7.Rectangle)  # -> BasePlane, XInterval, YInterval
deconstruct_domain_5 = DeconstructDomain(Domain=deconstuct_rectangle_3.YInterval)  # -> Start, End
deconstruct_domain_6 = DeconstructDomain(Domain=deconstuct_rectangle_3.XInterval)  # -> Start, End
scale_nu_3 = ScaleNU(
    Geometry=curve_59,
    Plane=PlaneXY(0, 0, 0),
    ScaleX=expr("1/X", deconstruct_domain_6.End),
    ScaleY=expr("1/X", deconstruct_domain_5.End),
    ScaleZ=1)  # -> Geometry, Transform
curve_62 = Curve(scale_nu_3.Geometry)
move_8 = Move(Geometry=curve_62, Motion=vector_xyz_4.Vector)  # -> Geometry, Transform
curve_63 = Curve(move_8.Geometry)  # disabled

stream_filter_9 = StreamFilter(Gate=number_slider_22, Stream0=curve_59, Stream1=curve_62)
curve_64 = Curve(stream_filter_9)
scale_19 = Scale(Geometry=curve_64, Center=Point(0, 0, 0), Factor=expr("2^X", number))  # -> Geometry, Transform
curve_65 = Curve(scale_19.Geometry)

stream_filter_10 = StreamFilter(Gate=number_slider_22, Stream0=curve_59, Stream1=curve_62)
curve_66 = Curve(stream_filter_10)
scale_20 = Scale(Geometry=curve_66, Center=Point(0, 0, 0), Factor=expr("2^X", number))  # -> Geometry, Transform
curve_67 = Curve(scale_20.Geometry)

end_points_8 = EndPoints(Curve=curve_65)  # -> Start, End
rectangle_2pt_8 = Rectangle2Pt(Plane=PlaneXY(0, 0, 0), PointA=end_points_8.Start, PointB=end_points_8.End, Radius=0)  # -> Rectangle, Length

number_16 = Number(number_5)

series_6 = Series(Start=0, Step=panel_65, Count=number_16)
expression_68 = Expression(O=series_6, Expression="FORMAT(\"{0:R}\",O)")  # disabled
panel_148 = Panel(expression_68)
bounds_5 = Bounds(Numbers=series_6)
expression_69 = Expression(X=number_16, Expression="1/X")
duplicate_data_6 = DuplicateData(Data=expression_69, Number=number_16, Order=True)

curve_graph_mapper_5 = CurveGraphMapper(Curves=curve_65, Rectangle=rectangle_2pt_8.Rectangle, Values=series_6, Flip=False, Snap=True, TextSize=0.015625)  # -> Mapped, GraphCurves, GraphPoints, ValueLines, ValuePoints, MappedLines, MappedPoints, Boundary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; disabled
graphmapper_5 = GraphMapper(Curve=curve_65, Boundary=rectangle_2pt_8.Rectangle, Numbers=series_6, Input=bounds_5, Output=bounds_5, bobo=True)  # disabled
stream_filter_11 = StreamFilter(Gate=number_slider_23, Stream0=curve_graph_mapper_5.Mapped, Stream1=graphmapper_5)

turtle_6 = DotNETVBScriptLEGACY(Forward=duplicate_data_6, Left=stream_filter_11)  # -> Output, Points; inputs Forward: list, Left: list; same code as turtle

expression_70 = Expression(O=turtle_6.Points, Expression="FORMAT(\"{0:R}\",O)")
panel_149 = Panel(expression_70)

point_10 = Point(turtle_6.Points)
scale_21 = Scale(Geometry=point_10, Center=Point(0, 0, 0), Factor=expr("2^X", digit_scroller_70))  # -> Geometry, Transform

interpolate_t_6 = InterpolateT(Vertices=scale_21.Geometry, TangentStart=Vector(0.0625, 0, 0), TangentEnd=Vector(0, 0, 0), KnotStyle=2)  # -> Curve, Length, Domain
evaluate_length_21 = EvaluateLength(Curve=interpolate_t_6.Curve, Length=1, Normalized=True)  # -> Point, Tangent, Parameter
line_sdl_9 = LineSDL(Start=evaluate_length_21.Point, Direction=evaluate_length_21.Tangent, Length=1)
mirror_10 = Mirror(Geometry=interpolate_t_6.Curve, Plane=line_sdl_9)  # -> Geometry, Transform
join_curves_11 = JoinCurves(Curves=[interpolate_t_6.Curve, mirror_10.Geometry], Preserve=False)
evaluate_length_22 = EvaluateLength(Curve=join_curves_11, Length=1, Normalized=True)  # -> Point, Tangent, Parameter
rotate_6 = Rotate(Geometry=join_curves_11, Angle=3.141592654, Plane=evaluate_length_22.Point)  # -> Geometry, Transform
join_curves_12 = JoinCurves(Curves=[join_curves_11, rotate_6.Geometry], Preserve=False)
curve_68 = Curve(join_curves_12)

evaluate_length_23 = EvaluateLength(Curve=join_curves_12, Length=1, Normalized=True)  # -> Point, Tangent, Parameter
deconstruct_11 = Deconstruct(Point=evaluate_length_23.Point)  # -> XComponent, YComponent, ZComponent
expression_71 = Expression(O=deconstruct_11.YComponent, Expression="FORMAT(\"{0:R}\",O)")
expression_72 = Expression(O=deconstruct_11.XComponent, Expression="FORMAT(\"{0:R}\",O)")
expression_73 = Expression(O=deconstruct_11.ZComponent, Expression="FORMAT(\"{0:R}\",O)")
panel_150 = Panel(expression_71)
panel_151 = Panel(expression_72)
panel_152 = Panel(expression_73)
addition_6 = Addition(A=panel_150, B=panel_151)
expression_74 = Expression(O=addition_6, Expression="FORMAT(\"{0:R}\",O)")
panel_153 = Panel(expression_74)
division_11 = Division(A=panel_153, B=2)
expression_75 = Expression(O=division_11, Expression="FORMAT(\"{0:R}\",O)")
panel_154 = Panel(expression_75)
scale_22 = Scale(Geometry=scale_21.Geometry, Center=Point(0, 0, 0), Factor=expr("1/X", panel_154))  # -> Geometry, Transform
scale_23 = Scale(Geometry=curve_68, Center=Point(0, 0, 0), Factor=expr("1/X", panel_154))  # -> Geometry, Transform
evaluate_length_24 = EvaluateLength(Curve=scale_23.Geometry, Length=1, Normalized=True)  # -> Point, Tangent, Parameter
deconstruct_12 = Deconstruct(Point=evaluate_length_24.Point)  # -> XComponent, YComponent, ZComponent
expression_76 = Expression(O=deconstruct_12.YComponent, Expression="FORMAT(\"{0:R}\",O)")
expression_77 = Expression(O=deconstruct_12.XComponent, Expression="FORMAT(\"{0:R}\",O)")
expression_78 = Expression(O=deconstruct_12.ZComponent, Expression="FORMAT(\"{0:R}\",O)")
panel_155 = Panel(expression_76)
panel_156 = Panel(expression_77)
panel_157 = Panel(expression_78)
division_12 = Division(A=panel_151, B=panel_150)
expression_79 = Expression(O=division_12, Expression="FORMAT(\"{0:R}\",O)")
panel_158 = Panel(expression_79)
curve_69 = Curve(scale_23.Geometry)
point_11 = Point(scale_22.Geometry)

move_9 = Move(Geometry=curve_69, Motion=vector_xyz_3.Vector)  # -> Geometry, Transform
mirror_11 = Mirror(Geometry=curve_69, Plane=PlaneYZ(0, 0, 0))  # -> Geometry, Transform; disabled
curve_70 = Curve(move_9.Geometry)

radians_9 = Radians(Degrees=number_3)

expression_80 = Expression(O=radians_9, Expression="FORMAT(\"{0:0.00000000000000000000}\",O)")
panel_160 = Panel(expression_80)
number_17 = Number(number_5)

end_points_9 = EndPoints(Curve=curve_67)  # -> Start, End
rectangle_2pt_9 = Rectangle2Pt(Plane=PlaneXY(0, 0, 0), PointA=end_points_9.Start, PointB=end_points_9.End, Radius=0)  # -> Rectangle, Length

series_7 = Series(Start=0, Step=panel_160, Count=number_17)
expression_81 = Expression(O=series_7, Expression="FORMAT(\"{0:R}\",O)")  # disabled
panel_161 = Panel(expression_81)
bounds_6 = Bounds(Numbers=series_7)
expression_82 = Expression(X=number_17, Expression="1/X")
duplicate_data_7 = DuplicateData(Data=expression_82, Number=number_17, Order=True)

curve_graph_mapper_6 = CurveGraphMapper(Curves=curve_67, Rectangle=rectangle_2pt_9.Rectangle, Values=series_7, Flip=False, Snap=True, TextSize=0.015625)  # -> Mapped, GraphCurves, GraphPoints, ValueLines, ValuePoints, MappedLines, MappedPoints, Boundary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; disabled
graphmapper_6 = GraphMapper(Curve=curve_67, Boundary=rectangle_2pt_9.Rectangle, Numbers=series_7, Input=bounds_6, Output=bounds_6, bobo=True)
stream_filter_12 = StreamFilter(Gate=number_slider_23, Stream0=curve_graph_mapper_6.Mapped, Stream1=graphmapper_6)

turtle_7 = DotNETVBScriptLEGACY(Forward=duplicate_data_7, Left=stream_filter_12)  # -> Output, Points; inputs Forward: list, Left: list; same code as turtle

expression_83 = Expression(O=turtle_7.Points, Expression="FORMAT(\"{0:R}\",O)")
panel_162 = Panel(expression_83)

point_12 = Point(turtle_7.Points)
scale_24 = Scale(Geometry=point_12, Center=Point(0, 0, 0), Factor=expr("2^X", digit_scroller_76))  # -> Geometry, Transform

interpolate_t_7 = InterpolateT(Vertices=scale_24.Geometry, TangentStart=Vector(0.0625, 0, 0), TangentEnd=Vector(0, 0, 0), KnotStyle=2)  # -> Curve, Length, Domain
evaluate_length_25 = EvaluateLength(Curve=interpolate_t_7.Curve, Length=1, Normalized=True)  # -> Point, Tangent, Parameter
line_sdl_10 = LineSDL(Start=evaluate_length_25.Point, Direction=evaluate_length_25.Tangent, Length=1)
mirror_12 = Mirror(Geometry=interpolate_t_7.Curve, Plane=line_sdl_10)  # -> Geometry, Transform
join_curves_13 = JoinCurves(Curves=[interpolate_t_7.Curve, mirror_12.Geometry], Preserve=False)
evaluate_length_26 = EvaluateLength(Curve=join_curves_13, Length=1, Normalized=True)  # -> Point, Tangent, Parameter
rotate_7 = Rotate(Geometry=join_curves_13, Angle=3.141592654, Plane=evaluate_length_26.Point)  # -> Geometry, Transform
join_curves_14 = JoinCurves(Curves=[join_curves_13, rotate_7.Geometry], Preserve=False)
curve_71 = Curve(join_curves_14)

evaluate_length_27 = EvaluateLength(Curve=join_curves_14, Length=1, Normalized=True)  # -> Point, Tangent, Parameter
deconstruct_13 = Deconstruct(Point=evaluate_length_27.Point)  # -> XComponent, YComponent, ZComponent
expression_84 = Expression(O=deconstruct_13.YComponent, Expression="FORMAT(\"{0:R}\",O)")
expression_85 = Expression(O=deconstruct_13.XComponent, Expression="FORMAT(\"{0:R}\",O)")
expression_86 = Expression(O=deconstruct_13.ZComponent, Expression="FORMAT(\"{0:R}\",O)")
panel_163 = Panel(expression_84)
panel_164 = Panel(expression_85)
panel_165 = Panel(expression_86)
addition_7 = Addition(A=panel_163, B=panel_164)
expression_87 = Expression(O=addition_7, Expression="FORMAT(\"{0:R}\",O)")
panel_166 = Panel(expression_87)
division_13 = Division(A=panel_166, B=2)
expression_88 = Expression(O=division_13, Expression="FORMAT(\"{0:R}\",O)")
panel_167 = Panel(expression_88)
scale_25 = Scale(Geometry=scale_24.Geometry, Center=Point(0, 0, 0), Factor=expr("1/X", panel_167))  # -> Geometry, Transform
scale_26 = Scale(Geometry=curve_71, Center=Point(0, 0, 0), Factor=expr("1/X", panel_167))  # -> Geometry, Transform
evaluate_length_28 = EvaluateLength(Curve=scale_26.Geometry, Length=1, Normalized=True)  # -> Point, Tangent, Parameter
deconstruct_14 = Deconstruct(Point=evaluate_length_28.Point)  # -> XComponent, YComponent, ZComponent
expression_89 = Expression(O=deconstruct_14.YComponent, Expression="FORMAT(\"{0:R}\",O)")
expression_90 = Expression(O=deconstruct_14.XComponent, Expression="FORMAT(\"{0:R}\",O)")
expression_91 = Expression(O=deconstruct_14.ZComponent, Expression="FORMAT(\"{0:R}\",O)")
panel_168 = Panel(expression_89)
panel_169 = Panel(expression_90)
panel_170 = Panel(expression_91)
division_14 = Division(A=panel_164, B=panel_163)
expression_92 = Expression(O=division_14, Expression="FORMAT(\"{0:R}\",O)")
panel_171 = Panel(expression_92)
curve_72 = Curve(scale_26.Geometry)
point_13 = Point(scale_25.Geometry)

move_10 = Move(Geometry=curve_72, Motion=Vector(7.5, 0, 0))  # -> Geometry, Transform
mirror_13 = Mirror(Geometry=curve_72, Plane=PlaneYZ(0, 0, 0))  # -> Geometry, Transform; disabled
curve_73 = Curve(move_10.Geometry)  # disabled

curve_74 = Curve(curve_72)
end_points_10 = EndPoints(Curve=curve_74)  # -> Start, End
rectangle_2pt_10 = Rectangle2Pt(Plane=PlaneXY(0, 0, 0), PointA=end_points_10.Start, PointB=end_points_10.End, Radius=0)  # -> Rectangle, Length
deconstuct_rectangle_4 = DeconstuctRectangle(Rectangle=rectangle_2pt_10.Rectangle)  # -> BasePlane, XInterval, YInterval
deconstruct_domain_7 = DeconstructDomain(Domain=deconstuct_rectangle_4.YInterval)  # -> Start, End
deconstruct_domain_8 = DeconstructDomain(Domain=deconstuct_rectangle_4.XInterval)  # -> Start, End
scale_nu_4 = ScaleNU(
    Geometry=curve_72,
    Plane=PlaneXY(0, 0, 0),
    ScaleX=expr("1/X", deconstruct_domain_8.End),
    ScaleY=expr("1/X", deconstruct_domain_7.End),
    ScaleZ=1)  # -> Geometry, Transform
curve_75 = Curve(scale_nu_4.Geometry)
move_11 = Move(Geometry=curve_75, Motion=vector_xyz_6.Vector)  # -> Geometry, Transform
curve_76 = Curve(move_11.Geometry)  # disabled

stream_filter_13 = StreamFilter(Gate=number_slider_22, Stream0=curve_72, Stream1=curve_75)
curve_77 = Curve(stream_filter_13)
scale_27 = Scale(Geometry=curve_77, Center=Point(0, 0, 0), Factor=expr("2^X", number))  # -> Geometry, Transform
curve_78 = Curve(scale_27.Geometry)

stream_filter_14 = StreamFilter(Gate=number_slider_22, Stream0=curve_72, Stream1=curve_75)
curve_79 = Curve(stream_filter_14)
scale_28 = Scale(Geometry=curve_79, Center=Point(0, 0, 0), Factor=expr("2^X", number))  # -> Geometry, Transform
curve_80 = Curve(scale_28.Geometry)

end_points_11 = EndPoints(Curve=curve_78)  # -> Start, End
rectangle_2pt_11 = Rectangle2Pt(Plane=PlaneXY(0, 0, 0), PointA=end_points_11.Start, PointB=end_points_11.End, Radius=0)  # -> Rectangle, Length

number_18 = Number(number_5)

series_8 = Series(Start=0, Step=panel_73, Count=number_18)
expression_93 = Expression(O=series_8, Expression="FORMAT(\"{0:R}\",O)")  # disabled
panel_173 = Panel(expression_93)
bounds_7 = Bounds(Numbers=series_8)
expression_94 = Expression(X=number_18, Expression="1/X")
duplicate_data_8 = DuplicateData(Data=expression_94, Number=number_18, Order=True)

curve_graph_mapper_7 = CurveGraphMapper(Curves=curve_78, Rectangle=rectangle_2pt_11.Rectangle, Values=series_8, Flip=False, Snap=True, TextSize=0.015625)  # -> Mapped, GraphCurves, GraphPoints, ValueLines, ValuePoints, MappedLines, MappedPoints, Boundary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; disabled
graphmapper_7 = GraphMapper(Curve=curve_78, Boundary=rectangle_2pt_11.Rectangle, Numbers=series_8, Input=bounds_7, Output=bounds_7, bobo=True)  # disabled
stream_filter_15 = StreamFilter(Gate=number_slider_23, Stream0=curve_graph_mapper_7.Mapped, Stream1=graphmapper_7)

turtle_8 = DotNETVBScriptLEGACY(Forward=duplicate_data_8, Left=stream_filter_15)  # -> Output, Points; inputs Forward: list, Left: list; same code as turtle

expression_95 = Expression(O=turtle_8.Points, Expression="FORMAT(\"{0:R}\",O)")
panel_174 = Panel(expression_95)

point_14 = Point(turtle_8.Points)
scale_29 = Scale(Geometry=point_14, Center=Point(0, 0, 0), Factor=expr("2^X", digit_scroller_77))  # -> Geometry, Transform

interpolate_t_8 = InterpolateT(Vertices=scale_29.Geometry, TangentStart=Vector(0.0625, 0, 0), TangentEnd=Vector(0, 0, 0), KnotStyle=2)  # -> Curve, Length, Domain
evaluate_length_29 = EvaluateLength(Curve=interpolate_t_8.Curve, Length=1, Normalized=True)  # -> Point, Tangent, Parameter
line_sdl_11 = LineSDL(Start=evaluate_length_29.Point, Direction=evaluate_length_29.Tangent, Length=1)
mirror_14 = Mirror(Geometry=interpolate_t_8.Curve, Plane=line_sdl_11)  # -> Geometry, Transform
join_curves_15 = JoinCurves(Curves=[interpolate_t_8.Curve, mirror_14.Geometry], Preserve=False)
evaluate_length_30 = EvaluateLength(Curve=join_curves_15, Length=1, Normalized=True)  # -> Point, Tangent, Parameter
rotate_8 = Rotate(Geometry=join_curves_15, Angle=3.141592654, Plane=evaluate_length_30.Point)  # -> Geometry, Transform
join_curves_16 = JoinCurves(Curves=[join_curves_15, rotate_8.Geometry], Preserve=False)
curve_81 = Curve(join_curves_16)

evaluate_length_31 = EvaluateLength(Curve=join_curves_16, Length=1, Normalized=True)  # -> Point, Tangent, Parameter
deconstruct_15 = Deconstruct(Point=evaluate_length_31.Point)  # -> XComponent, YComponent, ZComponent
expression_96 = Expression(O=deconstruct_15.YComponent, Expression="FORMAT(\"{0:R}\",O)")
expression_97 = Expression(O=deconstruct_15.XComponent, Expression="FORMAT(\"{0:R}\",O)")
expression_98 = Expression(O=deconstruct_15.ZComponent, Expression="FORMAT(\"{0:R}\",O)")
panel_175 = Panel(expression_96)
panel_176 = Panel(expression_97)
panel_177 = Panel(expression_98)
addition_8 = Addition(A=panel_175, B=panel_176)
expression_99 = Expression(O=addition_8, Expression="FORMAT(\"{0:R}\",O)")
panel_178 = Panel(expression_99)
division_15 = Division(A=panel_178, B=2)
expression_100 = Expression(O=division_15, Expression="FORMAT(\"{0:R}\",O)")
panel_179 = Panel(expression_100)
scale_30 = Scale(Geometry=scale_29.Geometry, Center=Point(0, 0, 0), Factor=expr("1/X", panel_179))  # -> Geometry, Transform
scale_31 = Scale(Geometry=curve_81, Center=Point(0, 0, 0), Factor=expr("1/X", panel_179))  # -> Geometry, Transform
evaluate_length_32 = EvaluateLength(Curve=scale_31.Geometry, Length=1, Normalized=True)  # -> Point, Tangent, Parameter
deconstruct_16 = Deconstruct(Point=evaluate_length_32.Point)  # -> XComponent, YComponent, ZComponent
expression_101 = Expression(O=deconstruct_16.YComponent, Expression="FORMAT(\"{0:R}\",O)")
expression_102 = Expression(O=deconstruct_16.XComponent, Expression="FORMAT(\"{0:R}\",O)")
expression_103 = Expression(O=deconstruct_16.ZComponent, Expression="FORMAT(\"{0:R}\",O)")
panel_180 = Panel(expression_101)
panel_181 = Panel(expression_102)
panel_182 = Panel(expression_103)
division_16 = Division(A=panel_176, B=panel_175)
expression_104 = Expression(O=division_16, Expression="FORMAT(\"{0:R}\",O)")
panel_183 = Panel(expression_104)
curve_82 = Curve(scale_31.Geometry)
point_15 = Point(scale_30.Geometry)

move_12 = Move(Geometry=curve_82, Motion=vector_xyz_5.Vector)  # -> Geometry, Transform
mirror_15 = Mirror(Geometry=curve_82, Plane=PlaneYZ(0, 0, 0))  # -> Geometry, Transform; disabled
curve_83 = Curve(move_12.Geometry)

number_19 = Number(expr("X*4", number_4))  # disabled
divide_curve_2 = DivideCurve(Curve=line_sdl_3, Count=expr("X/2", number_19), Kinks=False)  # -> Points, Tangents, Parameters; disabled
line_sdl_12 = LineSDL(Start=divide_curve_2.Points, Direction=Vector(0, 1, 0), Length=1)  # disabled
scale_32 = Scale(Geometry=line_sdl_12, Center=Point(0, 0, 0), Factor=expr("2^X", number_2))  # -> Geometry, Transform; disabled

number_20 = Number(expr("X*4", number_4))  # disabled

radians_10 = Radians(Degrees=number_3)

expression_105 = Expression(O=radians_10, Expression="FORMAT(\"{0:0.00000000000000000000}\",O)")
panel_185 = Panel(expression_105)
number_21 = Number(number_5)

end_points_12 = EndPoints(Curve=curve_80)  # -> Start, End
rectangle_2pt_12 = Rectangle2Pt(Plane=PlaneXY(0, 0, 0), PointA=end_points_12.Start, PointB=end_points_12.End, Radius=0)  # -> Rectangle, Length

series_9 = Series(Start=0, Step=panel_185, Count=number_21)
expression_106 = Expression(O=series_9, Expression="FORMAT(\"{0:R}\",O)")  # disabled
panel_186 = Panel(expression_106)
bounds_8 = Bounds(Numbers=series_9)
expression_107 = Expression(X=number_21, Expression="1/X")
duplicate_data_9 = DuplicateData(Data=expression_107, Number=number_21, Order=True)

curve_graph_mapper_8 = CurveGraphMapper(Curves=curve_80, Rectangle=rectangle_2pt_12.Rectangle, Values=series_9, Flip=False, Snap=True, TextSize=0.015625)  # -> Mapped, GraphCurves, GraphPoints, ValueLines, ValuePoints, MappedLines, MappedPoints, Boundary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; disabled
graphmapper_8 = GraphMapper(Curve=curve_80, Boundary=rectangle_2pt_12.Rectangle, Numbers=series_9, Input=bounds_8, Output=bounds_8, bobo=True)
stream_filter_16 = StreamFilter(Gate=number_slider_23, Stream0=curve_graph_mapper_8.Mapped, Stream1=graphmapper_8)

turtle_9 = DotNETVBScriptLEGACY(Forward=duplicate_data_9, Left=stream_filter_16)  # -> Output, Points; inputs Forward: list, Left: list; same code as turtle

expression_108 = Expression(O=turtle_9.Points, Expression="FORMAT(\"{0:R}\",O)")
panel_187 = Panel(expression_108)

point_16 = Point(turtle_9.Points)
scale_33 = Scale(Geometry=point_16, Center=Point(0, 0, 0), Factor=expr("2^X", digit_scroller_85))  # -> Geometry, Transform

interpolate_t_9 = InterpolateT(Vertices=scale_33.Geometry, TangentStart=Vector(0.0625, 0, 0), TangentEnd=Vector(0, 0, 0), KnotStyle=2)  # -> Curve, Length, Domain
evaluate_length_33 = EvaluateLength(Curve=interpolate_t_9.Curve, Length=1, Normalized=True)  # -> Point, Tangent, Parameter
line_sdl_13 = LineSDL(Start=evaluate_length_33.Point, Direction=evaluate_length_33.Tangent, Length=1)
mirror_16 = Mirror(Geometry=interpolate_t_9.Curve, Plane=line_sdl_13)  # -> Geometry, Transform
join_curves_17 = JoinCurves(Curves=[interpolate_t_9.Curve, mirror_16.Geometry], Preserve=False)
evaluate_length_34 = EvaluateLength(Curve=join_curves_17, Length=1, Normalized=True)  # -> Point, Tangent, Parameter
rotate_9 = Rotate(Geometry=join_curves_17, Angle=3.141592654, Plane=evaluate_length_34.Point)  # -> Geometry, Transform
join_curves_18 = JoinCurves(Curves=[join_curves_17, rotate_9.Geometry], Preserve=False)
curve_84 = Curve(join_curves_18)

evaluate_length_35 = EvaluateLength(Curve=join_curves_18, Length=1, Normalized=True)  # -> Point, Tangent, Parameter
deconstruct_17 = Deconstruct(Point=evaluate_length_35.Point)  # -> XComponent, YComponent, ZComponent
expression_109 = Expression(O=deconstruct_17.YComponent, Expression="FORMAT(\"{0:R}\",O)")
expression_110 = Expression(O=deconstruct_17.XComponent, Expression="FORMAT(\"{0:R}\",O)")
expression_111 = Expression(O=deconstruct_17.ZComponent, Expression="FORMAT(\"{0:R}\",O)")
panel_188 = Panel(expression_109)
panel_189 = Panel(expression_110)
panel_190 = Panel(expression_111)
addition_9 = Addition(A=panel_188, B=panel_189)
expression_112 = Expression(O=addition_9, Expression="FORMAT(\"{0:R}\",O)")
panel_191 = Panel(expression_112)
division_17 = Division(A=panel_191, B=2)
expression_113 = Expression(O=division_17, Expression="FORMAT(\"{0:R}\",O)")
panel_192 = Panel(expression_113)
scale_34 = Scale(Geometry=scale_33.Geometry, Center=Point(0, 0, 0), Factor=expr("1/X", panel_192))  # -> Geometry, Transform
scale_35 = Scale(Geometry=curve_84, Center=Point(0, 0, 0), Factor=expr("1/X", panel_192))  # -> Geometry, Transform
evaluate_length_36 = EvaluateLength(Curve=scale_35.Geometry, Length=1, Normalized=True)  # -> Point, Tangent, Parameter
deconstruct_18 = Deconstruct(Point=evaluate_length_36.Point)  # -> XComponent, YComponent, ZComponent
expression_114 = Expression(O=deconstruct_18.YComponent, Expression="FORMAT(\"{0:R}\",O)")
expression_115 = Expression(O=deconstruct_18.XComponent, Expression="FORMAT(\"{0:R}\",O)")
expression_116 = Expression(O=deconstruct_18.ZComponent, Expression="FORMAT(\"{0:R}\",O)")
panel_193 = Panel(expression_114)
panel_194 = Panel(expression_115)
panel_195 = Panel(expression_116)
division_18 = Division(A=panel_189, B=panel_188)
expression_117 = Expression(O=division_18, Expression="FORMAT(\"{0:R}\",O)")
panel_196 = Panel(expression_117)
curve_85 = Curve(scale_35.Geometry)
point_17 = Point(scale_34.Geometry)

move_13 = Move(Geometry=curve_85, Motion=Vector(10, 0, 0))  # -> Geometry, Transform
mirror_17 = Mirror(Geometry=curve_85, Plane=PlaneYZ(0, 0, 0))  # -> Geometry, Transform; disabled
curve_86 = Curve(move_13.Geometry)

curve_87 = Curve(curve_85)
end_points_13 = EndPoints(Curve=curve_87)  # -> Start, End
rectangle_2pt_13 = Rectangle2Pt(Plane=PlaneXY(0, 0, 0), PointA=end_points_13.Start, PointB=end_points_13.End, Radius=0)  # -> Rectangle, Length
deconstuct_rectangle_5 = DeconstuctRectangle(Rectangle=rectangle_2pt_13.Rectangle)  # -> BasePlane, XInterval, YInterval
deconstruct_domain_9 = DeconstructDomain(Domain=deconstuct_rectangle_5.YInterval)  # -> Start, End
deconstruct_domain_10 = DeconstructDomain(Domain=deconstuct_rectangle_5.XInterval)  # -> Start, End
scale_nu_5 = ScaleNU(
    Geometry=curve_85,
    Plane=PlaneXY(0, 0, 0),
    ScaleX=expr("1/X", deconstruct_domain_10.End),
    ScaleY=expr("1/X", deconstruct_domain_9.End),
    ScaleZ=1)  # -> Geometry, Transform
curve_88 = Curve(scale_nu_5.Geometry)
move_14 = Move(Geometry=curve_88, Motion=vector_xyz_8.Vector)  # -> Geometry, Transform
curve_89 = Curve(move_14.Geometry)

stream_filter_17 = StreamFilter(Gate=number_slider_22, Stream0=curve_85, Stream1=curve_88)
curve_90 = Curve(stream_filter_17)
scale_36 = Scale(Geometry=curve_90, Center=Point(0, 0, 0), Factor=expr("2^X", number))  # -> Geometry, Transform
curve_91 = Curve(scale_36.Geometry)

stream_filter_18 = StreamFilter(Gate=number_slider_22, Stream0=curve_85, Stream1=curve_88)
curve_92 = Curve(stream_filter_18)
scale_37 = Scale(Geometry=curve_92, Center=Point(0, 0, 0), Factor=expr("2^X", number))  # -> Geometry, Transform
curve_93 = Curve(scale_37.Geometry)

end_points_14 = EndPoints(Curve=curve_91)  # -> Start, End
rectangle_2pt_14 = Rectangle2Pt(Plane=PlaneXY(0, 0, 0), PointA=end_points_14.Start, PointB=end_points_14.End, Radius=0)  # -> Rectangle, Length

number_22 = Number(number_5)

series_10 = Series(Start=0, Step=panel_81, Count=number_22)
expression_118 = Expression(O=series_10, Expression="FORMAT(\"{0:R}\",O)")  # disabled
panel_198 = Panel(expression_118)
bounds_9 = Bounds(Numbers=series_10)
expression_119 = Expression(X=number_22, Expression="1/X")
duplicate_data_10 = DuplicateData(Data=expression_119, Number=number_22, Order=True)

curve_graph_mapper_9 = CurveGraphMapper(Curves=curve_91, Rectangle=rectangle_2pt_14.Rectangle, Values=series_10, Flip=False, Snap=True, TextSize=0.015625)  # -> Mapped, GraphCurves, GraphPoints, ValueLines, ValuePoints, MappedLines, MappedPoints, Boundary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; disabled
graphmapper_9 = GraphMapper(Curve=curve_91, Boundary=rectangle_2pt_14.Rectangle, Numbers=series_10, Input=bounds_9, Output=bounds_9, bobo=True)
stream_filter_19 = StreamFilter(Gate=number_slider_23, Stream0=curve_graph_mapper_9.Mapped, Stream1=graphmapper_9)

turtle_10 = DotNETVBScriptLEGACY(Forward=duplicate_data_10, Left=stream_filter_19)  # -> Output, Points; inputs Forward: list, Left: list; same code as turtle

expression_120 = Expression(O=turtle_10.Points, Expression="FORMAT(\"{0:R}\",O)")
panel_199 = Panel(expression_120)

point_18 = Point(turtle_10.Points)
scale_38 = Scale(Geometry=point_18, Center=Point(0, 0, 0), Factor=expr("2^X", digit_scroller_84))  # -> Geometry, Transform

interpolate_t_10 = InterpolateT(Vertices=scale_38.Geometry, TangentStart=Vector(0.0625, 0, 0), TangentEnd=Vector(0, 0, 0), KnotStyle=2)  # -> Curve, Length, Domain
evaluate_length_37 = EvaluateLength(Curve=interpolate_t_10.Curve, Length=1, Normalized=True)  # -> Point, Tangent, Parameter
line_sdl_14 = LineSDL(Start=evaluate_length_37.Point, Direction=evaluate_length_37.Tangent, Length=1)
mirror_18 = Mirror(Geometry=interpolate_t_10.Curve, Plane=line_sdl_14)  # -> Geometry, Transform
join_curves_19 = JoinCurves(Curves=[interpolate_t_10.Curve, mirror_18.Geometry], Preserve=False)
evaluate_length_38 = EvaluateLength(Curve=join_curves_19, Length=1, Normalized=True)  # -> Point, Tangent, Parameter
rotate_10 = Rotate(Geometry=join_curves_19, Angle=3.141592654, Plane=evaluate_length_38.Point)  # -> Geometry, Transform
join_curves_20 = JoinCurves(Curves=[join_curves_19, rotate_10.Geometry], Preserve=False)
curve_94 = Curve(join_curves_20)

evaluate_length_39 = EvaluateLength(Curve=join_curves_20, Length=1, Normalized=True)  # -> Point, Tangent, Parameter
deconstruct_19 = Deconstruct(Point=evaluate_length_39.Point)  # -> XComponent, YComponent, ZComponent
expression_121 = Expression(O=deconstruct_19.YComponent, Expression="FORMAT(\"{0:R}\",O)")
expression_122 = Expression(O=deconstruct_19.XComponent, Expression="FORMAT(\"{0:R}\",O)")
expression_123 = Expression(O=deconstruct_19.ZComponent, Expression="FORMAT(\"{0:R}\",O)")
panel_200 = Panel(expression_121)
panel_201 = Panel(expression_122)
panel_202 = Panel(expression_123)
addition_10 = Addition(A=panel_200, B=panel_201)
expression_124 = Expression(O=addition_10, Expression="FORMAT(\"{0:R}\",O)")
panel_203 = Panel(expression_124)
division_19 = Division(A=panel_203, B=2)
expression_125 = Expression(O=division_19, Expression="FORMAT(\"{0:R}\",O)")
panel_204 = Panel(expression_125)
scale_39 = Scale(Geometry=scale_38.Geometry, Center=Point(0, 0, 0), Factor=expr("1/X", panel_204))  # -> Geometry, Transform
scale_40 = Scale(Geometry=curve_94, Center=Point(0, 0, 0), Factor=expr("1/X", panel_204))  # -> Geometry, Transform
evaluate_length_40 = EvaluateLength(Curve=scale_40.Geometry, Length=1, Normalized=True)  # -> Point, Tangent, Parameter
deconstruct_20 = Deconstruct(Point=evaluate_length_40.Point)  # -> XComponent, YComponent, ZComponent
expression_126 = Expression(O=deconstruct_20.YComponent, Expression="FORMAT(\"{0:R}\",O)")
expression_127 = Expression(O=deconstruct_20.XComponent, Expression="FORMAT(\"{0:R}\",O)")
expression_128 = Expression(O=deconstruct_20.ZComponent, Expression="FORMAT(\"{0:R}\",O)")
panel_205 = Panel(expression_126)
panel_206 = Panel(expression_127)
panel_207 = Panel(expression_128)
division_20 = Division(A=panel_201, B=panel_200)
expression_129 = Expression(O=division_20, Expression="FORMAT(\"{0:R}\",O)")
panel_208 = Panel(expression_129)
curve_95 = Curve(scale_40.Geometry)
point_19 = Point(scale_39.Geometry)

curve_96 = Curve(curve_95)

curve_97 = Curve(curve_96)
curve_domain = CurveDomain(Curve=curve_97)  # -> Curve, Domain
deconstruct_domain_11 = DeconstructDomain(Domain=curve_domain.Domain)  # -> Start, End
construct_domain = ConstructDomain(DomainStart=expr("X/2", deconstruct_domain_11.End), DomainEnd=deconstruct_domain_11.End)
sub_curve = SubCurve(BaseCurve=curve_domain.Curve, Domain=construct_domain)
move_15 = Move(Geometry=sub_curve, Motion=Vector(-0.5, -0.5, 0))  # -> Geometry, Transform
scale_41 = Scale(Geometry=move_15.Geometry, Center=Point(0, 0, 0), Factor=2)  # -> Geometry, Transform
curve_98 = Curve(scale_41.Geometry)

curve_99 = Curve(curve_98)  # disabled
scale_42 = Scale(Geometry=curve_99, Center=Point(0, 0, 0), Factor=expr("2^X", number_2))  # -> Geometry, Transform; disabled
curve_curve = CurveCurve(CurveA=scale_42.Geometry, CurveB=scale_32.Geometry)  # -> flatten(Points), ParamsA, ParamsB; disabled
scale_43 = Scale(Geometry=curve_curve.Points, Center=Point(0, 0, 0), Factor=expr("1/2^X", number_2))  # -> Geometry, Transform; disabled
deconstruct_21 = Deconstruct(Point=scale_43.Geometry)  # -> expr("ABS(X)", graft(XComponent)), expr("ABS(X)", graft(YComponent)), expr("ABS(X)", graft(ZComponent)); disabled
construct_point_2 = ConstructPoint(XCoordinate=deconstruct_21.XComponent, YCoordinate=deconstruct_21.YComponent, ZCoordinate=deconstruct_21.ZComponent)  # disabled
list_length = ListLength(List=scale_43.Geometry)  # disabled
panel_210 = Panel(list_length)  # disabled
construct_domain_2 = ConstructDomain(DomainStart=0, DomainEnd=expr("X-2", panel_210))  # disabled
range = Range(Domain=construct_domain_2, Steps=expr("X-2", panel_210))  # disabled
list_item = ListItem(List=flatten(construct_point_2), Index=range, Wrap=False)  # -> flatten(Item); disabled
rotate_11 = Rotate(Geometry=list_item, Angle=3.141592654, Plane=construct_point)  # -> reverse(flatten(Geometry)), Transform; disabled
merge = Merge(Data1=list_item, Data2=construct_point, Data3=rotate_11.Geometry)  # disabled
deconstruct_22 = Deconstruct(Point=merge)  # -> graft(XComponent), graft(YComponent), ZComponent; disabled
expression_130 = Expression(O=deconstruct_22.XComponent, Expression="FORMAT(\"{0:0.0000000000}\",O)")  # disabled
expression_131 = Expression(O=deconstruct_22.XComponent, Expression="FORMAT(\"{0:R}\",O)")  # disabled
data = Data(expression_130)  # disabled
panel_211 = Panel(data)  # disabled
expression_132 = Expression(O=deconstruct_22.YComponent, Expression="FORMAT(\"{0:0.00000000000000}\",O)")  # disabled
expression_133 = Expression(O=deconstruct_22.YComponent, Expression="FORMAT(\"{0:R}\",O)")  # disabled
data_2 = Data(expression_133)  # disabled
panel_212 = Panel(data_2)  # disabled
txtwriter = VBScript(filePath=file_path, data=flatten(panel_212), activate=button)  # -> out, A; inputs data: list; disabled
# ---------- txtwriter: VB ----------
    If activate Then

      Dim i As Integer
      Dim aryText(4) As String

      aryText(0) = "Mary WriteLine"
      aryText(1) = "Had"
      aryText(2) = "Another"
      aryText(3) = "Little"
      aryText(4) = "One"

      ' the data is appended to the file. If file doesnt exist, a new file is created
      Dim objWriter As New System.IO.StreamWriter(filePath, append)

      For i = 0 To data.Count - 1
        objWriter.WriteLine(data(i))
      Next

      objWriter.Close()

    End If

    If clearFile Then
      Dim objWriter As New System.IO.StreamWriter(filePath, False)
      objWriter.Close()
    End If
# ---------- end txtwriter ----------

curve_100 = Curve(curve_98)  # disabled
divide_curve_3 = DivideCurve(Curve=curve_100, Count=number_20, Kinks=False)  # -> Points, Tangents, Parameters; disabled
deconstruct_23 = Deconstruct(Point=divide_curve_3.Points)  # -> graft(XComponent), graft(YComponent), ZComponent; disabled
expression_134 = Expression(Y=deconstruct_23.YComponent, Expression="FORMAT(\"{0:R}\",ROUND(Y, 15))")  # -> simplify(Result); disabled
expression_135 = Expression(X=deconstruct_23.XComponent, Expression="FORMAT(\"{0:R}\",ROUND(X, 15))")  # -> simplify(Result); disabled
expression_136 = Expression(X=deconstruct_23.XComponent, Expression="FORMAT(\"{0:R}\",X)")  # -> simplify(Result); disabled
panel_213 = Panel(expression_136)  # disabled
expression_137 = Expression(Y=deconstruct_23.YComponent, Expression="FORMAT(\"{0:R}\",Y)")  # -> simplify(Result); disabled
list_length_2 = ListLength(List=divide_curve_3.Points)  # disabled
duplicate_data_11 = DuplicateData(Data=",", Number=list_length_2, Order=True)  # -> simplify(graft(Data)); disabled
panel_214 = Panel(duplicate_data_11)  # disabled
panel_215 = Panel(expression_137)  # disabled
concatenate = Concatenate(FragmentA=panel_213, FragmentB=panel_214, FragmentA_2=panel_215)  # -> flatten(Result); disabled
panel_216 = Panel(concatenate)  # disabled
txtwriter_2 = VBScript(filePath=file_path_2, data=flatten(panel_216), activate=button_2)  # -> out, A; inputs data: list; disabled; same code as txtwriter

move_16 = Move(Geometry=curve_95, Motion=vector_xyz_7.Vector)  # -> Geometry, Transform
mirror_19 = Mirror(Geometry=curve_95, Plane=PlaneYZ(0, 0, 0))  # -> Geometry, Transform; disabled
curve_101 = Curve(move_16.Geometry)

number_23 = Number(expr("X*4", number_4))  # disabled
curve_102 = Curve(curve_98)  # disabled
evaluate_length_41 = EvaluateLength(Curve=curve_102, Length=flatten(1), Normalized=True)  # -> Point, Tangent, Parameter; disabled
yz_plane = YZPlane(Origin=evaluate_length_41.Point)  # disabled
mirror_20 = Mirror(Geometry=curve_102, Plane=yz_plane)  # -> Geometry, Transform; disabled
join_curves_21 = JoinCurves(Curves=[curve_102, mirror_20.Geometry], Preserve=False)  # disabled
linear_array = LinearArray(Geometry=join_curves_21, Direction=Vector(2, 0, 0), Count=2)  # -> Geometry, Transform; disabled
join_curves_22 = JoinCurves(Curves=linear_array.Geometry, Preserve=False)  # disabled
flip_curve = FlipCurve(Curve=join_curves_22)  # -> Curve, Flag; disabled
stream_filter_20 = StreamFilter(Gate=number_slider_19, Stream0=join_curves_22, Stream1=flip_curve.Curve)  # disabled
curve_domain_2 = CurveDomain(Curve=stream_filter_20)  # -> Curve, Domain; disabled
deconstruct_domain_12 = DeconstructDomain(Domain=curve_domain_2.Domain)  # -> Start, End; disabled
construct_domain_3 = ConstructDomain(DomainStart=expr("X/8", deconstruct_domain_12.End), DomainEnd=expr("X*5/8", deconstruct_domain_12.End))  # disabled
sub_curve_2 = SubCurve(BaseCurve=curve_domain_2.Curve, Domain=construct_domain_3)  # disabled
move_17 = Move(Geometry=sub_curve_2, Motion=Vector(-0.5, -0.5, 0))  # -> Geometry, Transform; disabled
scale_44 = Scale(Geometry=move_17.Geometry, Center=Point(0, 0, 0), Factor=0.5)  # -> Geometry, Transform; disabled
divide_curve_4 = DivideCurve(Curve=scale_44.Geometry, Count=number_23, Kinks=False)  # -> Points, Tangents, Parameters; disabled
deconstruct_24 = Deconstruct(Point=divide_curve_4.Points)  # -> simplify(graft(XComponent)), simplify(graft(YComponent)), ZComponent; disabled
expression_138 = Expression(X=deconstruct_24.XComponent, Expression="FORMAT(\"{0:R}\",X)")  # disabled
panel_217 = Panel(expression_138)  # disabled
expression_139 = Expression(Y=deconstruct_24.YComponent, Expression="FORMAT(\"{0:R}\",Y)")  # disabled
list_length_3 = ListLength(List=divide_curve_4.Points)  # disabled
duplicate_data_12 = DuplicateData(Data=";", Number=list_length_3, Order=True)  # -> simplify(graft(Data)); disabled
panel_218 = Panel(duplicate_data_12)  # disabled
panel_219 = Panel(expression_139)  # disabled
concatenate_2 = Concatenate(FragmentA=panel_217, FragmentB=panel_218, FragmentA_2=panel_219)  # -> flatten(Result); disabled
panel_220 = Panel(concatenate_2)  # disabled
txtwriter_3 = VBScript(filePath=file_path_3, data=flatten(panel_220), activate=button_3)  # -> out, A; inputs data: list; disabled; same code as txtwriter

digit_scroller_91 = DigitScroller(Scroller_Digits=12, Scroller_Prefix=" ", Scroller_Radix=1, Scroller_Value=0.0013733121)
panel_221 = Panel("256    0.001373312102167")

radians_11 = Radians(Degrees=number_3)

expression_140 = Expression(O=radians_11, Expression="FORMAT(\"{0:0.00000000000000000000}\",O)")
panel_223 = Panel(expression_140)
number_24 = Number(number_5)

end_points_15 = EndPoints(Curve=curve_93)  # -> Start, End
rectangle_2pt_15 = Rectangle2Pt(Plane=PlaneXY(0, 0, 0), PointA=end_points_15.Start, PointB=end_points_15.End, Radius=0)  # -> Rectangle, Length

series_11 = Series(Start=0, Step=panel_223, Count=number_24)
expression_141 = Expression(O=series_11, Expression="FORMAT(\"{0:R}\",O)")  # disabled
panel_224 = Panel(expression_141)
bounds_10 = Bounds(Numbers=series_11)
expression_142 = Expression(X=number_24, Expression="1/X")
duplicate_data_13 = DuplicateData(Data=expression_142, Number=number_24, Order=True)

curve_graph_mapper_10 = CurveGraphMapper(Curves=curve_93, Rectangle=rectangle_2pt_15.Rectangle, Values=series_11, Flip=False, Snap=True, TextSize=0.015625)  # -> Mapped, GraphCurves, GraphPoints, ValueLines, ValuePoints, MappedLines, MappedPoints, Boundary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; disabled
graphmapper_10 = GraphMapper(Curve=curve_93, Boundary=rectangle_2pt_15.Rectangle, Numbers=series_11, Input=bounds_10, Output=bounds_10, bobo=False)  # disabled
stream_filter_21 = StreamFilter(Gate=number_slider_23, Stream0=curve_graph_mapper_10.Mapped, Stream1=graphmapper_10)

turtle_11 = DotNETVBScriptLEGACY(Forward=duplicate_data_13, Left=stream_filter_21)  # -> Output, Points; inputs Forward: list, Left: list; same code as turtle

expression_143 = Expression(O=turtle_11.Points, Expression="FORMAT(\"{0:R}\",O)")
panel_225 = Panel(expression_143)

point_20 = Point(turtle_11.Points)
scale_45 = Scale(Geometry=point_20, Center=Point(0, 0, 0), Factor=expr("2^X", digit_scroller_88))  # -> Geometry, Transform

interpolate_t_11 = InterpolateT(Vertices=scale_45.Geometry, TangentStart=Vector(0.0625, 0, 0), TangentEnd=Vector(0, 0, 0), KnotStyle=2)  # -> Curve, Length, Domain
evaluate_length_42 = EvaluateLength(Curve=interpolate_t_11.Curve, Length=1, Normalized=True)  # -> Point, Tangent, Parameter
line_sdl_15 = LineSDL(Start=evaluate_length_42.Point, Direction=evaluate_length_42.Tangent, Length=1)
mirror_21 = Mirror(Geometry=interpolate_t_11.Curve, Plane=line_sdl_15)  # -> Geometry, Transform
join_curves_23 = JoinCurves(Curves=[interpolate_t_11.Curve, mirror_21.Geometry], Preserve=False)
evaluate_length_43 = EvaluateLength(Curve=join_curves_23, Length=1, Normalized=True)  # -> Point, Tangent, Parameter
rotate_12 = Rotate(Geometry=join_curves_23, Angle=3.141592654, Plane=evaluate_length_43.Point)  # -> Geometry, Transform
join_curves_24 = JoinCurves(Curves=[join_curves_23, rotate_12.Geometry], Preserve=False)
curve_103 = Curve(join_curves_24)

evaluate_length_44 = EvaluateLength(Curve=join_curves_24, Length=1, Normalized=True)  # -> Point, Tangent, Parameter
deconstruct_25 = Deconstruct(Point=evaluate_length_44.Point)  # -> XComponent, YComponent, ZComponent
expression_144 = Expression(O=deconstruct_25.YComponent, Expression="FORMAT(\"{0:R}\",O)")
expression_145 = Expression(O=deconstruct_25.XComponent, Expression="FORMAT(\"{0:R}\",O)")
expression_146 = Expression(O=deconstruct_25.ZComponent, Expression="FORMAT(\"{0:R}\",O)")
panel_226 = Panel(expression_144)
panel_227 = Panel(expression_145)
panel_228 = Panel(expression_146)
addition_11 = Addition(A=panel_226, B=panel_227)
expression_147 = Expression(O=addition_11, Expression="FORMAT(\"{0:R}\",O)")
panel_229 = Panel(expression_147)
division_21 = Division(A=panel_229, B=2)
expression_148 = Expression(O=division_21, Expression="FORMAT(\"{0:R}\",O)")
panel_230 = Panel(expression_148)
scale_46 = Scale(Geometry=scale_45.Geometry, Center=Point(0, 0, 0), Factor=expr("1/X", panel_230))  # -> Geometry, Transform
scale_47 = Scale(Geometry=curve_103, Center=Point(0, 0, 0), Factor=expr("1/X", panel_230))  # -> Geometry, Transform
evaluate_length_45 = EvaluateLength(Curve=scale_47.Geometry, Length=1, Normalized=True)  # -> Point, Tangent, Parameter
deconstruct_26 = Deconstruct(Point=evaluate_length_45.Point)  # -> XComponent, YComponent, ZComponent
expression_149 = Expression(O=deconstruct_26.YComponent, Expression="FORMAT(\"{0:R}\",O)")
expression_150 = Expression(O=deconstruct_26.XComponent, Expression="FORMAT(\"{0:R}\",O)")
expression_151 = Expression(O=deconstruct_26.ZComponent, Expression="FORMAT(\"{0:R}\",O)")
panel_231 = Panel(expression_149)
panel_232 = Panel(expression_150)
panel_233 = Panel(expression_151)
division_22 = Division(A=panel_227, B=panel_226)
expression_152 = Expression(O=division_22, Expression="FORMAT(\"{0:R}\",O)")
panel_234 = Panel(expression_152)
curve_104 = Curve(scale_47.Geometry)
point_21 = Point(scale_46.Geometry)

move_18 = Move(Geometry=curve_104, Motion=Vector(12.5, 0, 0))  # -> Geometry, Transform
mirror_22 = Mirror(Geometry=curve_104, Plane=PlaneYZ(0, 0, 0))  # -> Geometry, Transform; disabled
curve_105 = Curve(move_18.Geometry)

curve_106 = Curve(curve_104)
end_points_16 = EndPoints(Curve=curve_106)  # -> Start, End
rectangle_2pt_16 = Rectangle2Pt(Plane=PlaneXY(0, 0, 0), PointA=end_points_16.Start, PointB=end_points_16.End, Radius=0)  # -> Rectangle, Length
deconstuct_rectangle_6 = DeconstuctRectangle(Rectangle=rectangle_2pt_16.Rectangle)  # -> BasePlane, XInterval, YInterval
deconstruct_domain_13 = DeconstructDomain(Domain=deconstuct_rectangle_6.YInterval)  # -> Start, End
deconstruct_domain_14 = DeconstructDomain(Domain=deconstuct_rectangle_6.XInterval)  # -> Start, End
scale_nu_6 = ScaleNU(
    Geometry=curve_104,
    Plane=PlaneXY(0, 0, 0),
    ScaleX=expr("1/X", deconstruct_domain_14.End),
    ScaleY=expr("1/X", deconstruct_domain_13.End),
    ScaleZ=1)  # -> Geometry, Transform
curve_107 = Curve(scale_nu_6.Geometry)
move_19 = Move(Geometry=curve_107, Motion=vector_xyz_9.Vector)  # -> Geometry, Transform
curve_108 = Curve(move_19.Geometry)

digit_scroller_92 = DigitScroller(Scroller_Digits=12, Scroller_Prefix=" ", Scroller_Radix=2, Scroller_Value=0)
stream_filter_22 = StreamFilter(Gate=number_slider_22, Stream0=curve_104, Stream1=curve_107)
curve_109 = Curve(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)
curve_110 = Curve(stream_filter_22)
scale_48 = Scale(Geometry=curve_110, Center=Point(0, 0, 0), Factor=expr("2^X", number))  # -> Geometry, Transform
curve_111 = Curve(scale_48.Geometry)
curve_112 = Curve(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)

digit_scroller_93 = DigitScroller(Scroller_Digits=12, Scroller_Prefix="Digit Scroller", Scroller_Radix=1, Scroller_Value=0.00140149998)
number_slider_24 = Slider(256, range=0..65536)
radians_12 = Radians(Degrees=number_3)

expression_153 = Expression(O=radians_12, Expression="FORMAT(\"{0:0.00000000000000000000}\",O)")
panel_240 = Panel(expression_153)
curve_113 = Curve(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)
number_25 = Number(number_5)

digit_scroller_94 = DigitScroller(Scroller_Digits=12, Scroller_Prefix=" ", Scroller_Radix=7, Scroller_Value=16)

number_slider_25 = Slider(1, range=0..1)
end_points_17 = EndPoints(Curve=curve_111)  # -> Start, End
rectangle_2pt_17 = Rectangle2Pt(Plane=PlaneXY(0, 0, 0), PointA=end_points_17.Start, PointB=end_points_17.End, Radius=0)  # -> Rectangle, Length

series_12 = Series(Start=0, Step=panel_240, Count=number_25)
expression_154 = Expression(O=series_12, Expression="FORMAT(\"{0:R}\",O)")  # disabled
panel_241 = Panel(expression_154)
bounds_11 = Bounds(Numbers=series_12)
expression_155 = Expression(X=number_25, Expression="1/X")
duplicate_data_14 = DuplicateData(Data=expression_155, Number=number_25, Order=True)

curve_graph_mapper_11 = CurveGraphMapper(Curves=curve_111, Rectangle=rectangle_2pt_17.Rectangle, Values=series_12, Flip=False, Snap=True, TextSize=0.015625)  # -> Mapped, GraphCurves, GraphPoints, ValueLines, ValuePoints, MappedLines, MappedPoints, Boundary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; disabled
graphmapper_11 = GraphMapper(Curve=curve_111, Boundary=rectangle_2pt_17.Rectangle, Numbers=series_12, Input=bounds_11, Output=bounds_11, bobo=False)
stream_filter_23 = StreamFilter(Gate=number_slider_23, Stream0=curve_graph_mapper_11.Mapped, Stream1=graphmapper_11)

turtle_12 = DotNETVBScriptLEGACY(Forward=duplicate_data_14, Left=stream_filter_23)  # -> Output, Points; inputs Forward: list, Left: list; same code as turtle

expression_156 = Expression(O=turtle_12.Points, Expression="FORMAT(\"{0:R}\",O)")
panel_242 = Panel(expression_156)

point_22 = Point(turtle_12.Points)
scale_49 = Scale(Geometry=point_22, Center=Point(0, 0, 0), Factor=expr("2^X", digit_scroller_94))  # -> Geometry, Transform

interpolate_t_12 = InterpolateT(Vertices=scale_49.Geometry, TangentStart=Vector(0.0625, 0, 0), TangentEnd=Vector(0, 0, 0), KnotStyle=2)  # -> Curve, Length, Domain
evaluate_length_46 = EvaluateLength(Curve=interpolate_t_12.Curve, Length=1, Normalized=True)  # -> Point, Tangent, Parameter
line_sdl_16 = LineSDL(Start=evaluate_length_46.Point, Direction=evaluate_length_46.Tangent, Length=1)
mirror_23 = Mirror(Geometry=interpolate_t_12.Curve, Plane=line_sdl_16)  # -> Geometry, Transform
join_curves_25 = JoinCurves(Curves=[interpolate_t_12.Curve, mirror_23.Geometry], Preserve=False)
evaluate_length_47 = EvaluateLength(Curve=join_curves_25, Length=1, Normalized=True)  # -> Point, Tangent, Parameter
rotate_13 = Rotate(Geometry=join_curves_25, Angle=3.141592654, Plane=evaluate_length_47.Point)  # -> Geometry, Transform
join_curves_26 = JoinCurves(Curves=[join_curves_25, rotate_13.Geometry], Preserve=False)
curve_114 = Curve(join_curves_26)

evaluate_length_48 = EvaluateLength(Curve=join_curves_26, Length=1, Normalized=True)  # -> Point, Tangent, Parameter
deconstruct_27 = Deconstruct(Point=evaluate_length_48.Point)  # -> XComponent, YComponent, ZComponent
expression_157 = Expression(O=deconstruct_27.YComponent, Expression="FORMAT(\"{0:R}\",O)")
expression_158 = Expression(O=deconstruct_27.XComponent, Expression="FORMAT(\"{0:R}\",O)")
expression_159 = Expression(O=deconstruct_27.ZComponent, Expression="FORMAT(\"{0:R}\",O)")
panel_243 = Panel(expression_157)
panel_244 = Panel(expression_158)
panel_245 = Panel(expression_159)
addition_12 = Addition(A=panel_243, B=panel_244)
expression_160 = Expression(O=addition_12, Expression="FORMAT(\"{0:R}\",O)")
panel_246 = Panel(expression_160)
division_23 = Division(A=panel_246, B=2)
expression_161 = Expression(O=division_23, Expression="FORMAT(\"{0:R}\",O)")
panel_247 = Panel(expression_161)
scale_50 = Scale(Geometry=scale_49.Geometry, Center=Point(0, 0, 0), Factor=expr("1/X", panel_247))  # -> Geometry, Transform
scale_51 = Scale(Geometry=curve_114, Center=Point(0, 0, 0), Factor=expr("1/X", panel_247))  # -> Geometry, Transform
evaluate_length_49 = EvaluateLength(Curve=scale_51.Geometry, Length=1, Normalized=True)  # -> Point, Tangent, Parameter
deconstruct_28 = Deconstruct(Point=evaluate_length_49.Point)  # -> XComponent, YComponent, ZComponent
expression_162 = Expression(O=deconstruct_28.YComponent, Expression="FORMAT(\"{0:R}\",O)")
expression_163 = Expression(O=deconstruct_28.XComponent, Expression="FORMAT(\"{0:R}\",O)")
expression_164 = Expression(O=deconstruct_28.ZComponent, Expression="FORMAT(\"{0:R}\",O)")
panel_248 = Panel(expression_162)
panel_249 = Panel(expression_163)
panel_250 = Panel(expression_164)
division_24 = Division(A=panel_244, B=panel_243)
expression_165 = Expression(O=division_24, Expression="FORMAT(\"{0:R}\",O)")
panel_251 = Panel(expression_165)
curve_115 = Curve(scale_51.Geometry)
point_23 = Point(scale_50.Geometry)

move_20 = Move(Geometry=curve_115, Motion=Vector(15, 0, 0))  # -> Geometry, Transform
mirror_24 = Mirror(Geometry=curve_115, Plane=PlaneYZ(0, 0, 0))  # -> Geometry, Transform; disabled
curve_116 = Curve(move_20.Geometry)

vector_xyz_10 = VectorXYZ(XComponent=15, YComponent=1.5, ZComponent=0)  # -> Vector, Length
curve_117 = Curve(curve_115)
end_points_18 = EndPoints(Curve=curve_117)  # -> Start, End
rectangle_2pt_18 = Rectangle2Pt(Plane=PlaneXY(0, 0, 0), PointA=end_points_18.Start, PointB=end_points_18.End, Radius=0)  # -> Rectangle, Length
deconstuct_rectangle_7 = DeconstuctRectangle(Rectangle=rectangle_2pt_18.Rectangle)  # -> BasePlane, XInterval, YInterval
deconstruct_domain_15 = DeconstructDomain(Domain=deconstuct_rectangle_7.YInterval)  # -> Start, End
deconstruct_domain_16 = DeconstructDomain(Domain=deconstuct_rectangle_7.XInterval)  # -> Start, End
scale_nu_7 = ScaleNU(
    Geometry=curve_115,
    Plane=PlaneXY(0, 0, 0),
    ScaleX=expr("1/X", deconstruct_domain_16.End),
    ScaleY=expr("1/X", deconstruct_domain_15.End),
    ScaleZ=1)  # -> Geometry, Transform
curve_118 = Curve(scale_nu_7.Geometry)
move_21 = Move(Geometry=curve_118, Motion=vector_xyz_10.Vector)  # -> Geometry, Transform
curve_119 = Curve(move_21.Geometry)

digit_scroller_95 = DigitScroller(Scroller_Digits=12, Scroller_Prefix=" ", Scroller_Radix=2, Scroller_Value=0)
stream_filter_24 = StreamFilter(Gate=number_slider_22, Stream0=curve_115, Stream1=curve_118)
curve_120 = Curve(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)
curve_121 = Curve(stream_filter_24)
scale_52 = Scale(Geometry=curve_121, Center=Point(0, 0, 0), Factor=expr("2^X", number))  # -> Geometry, Transform
curve_122 = Curve(scale_52.Geometry)
curve_123 = Curve(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)

digit_scroller_96 = DigitScroller(Scroller_Digits=12, Scroller_Prefix="Digit Scroller", Scroller_Radix=1, Scroller_Value=0.00140149998)
number_slider_26 = Slider(256, range=0..65536)
radians_13 = Radians(Degrees=number_3)

expression_166 = Expression(O=radians_13, Expression="FORMAT(\"{0:0.00000000000000000000}\",O)")
panel_257 = Panel(expression_166)
curve_124 = Curve(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)
number_26 = Number(number_5)

digit_scroller_97 = DigitScroller(Scroller_Digits=12, Scroller_Prefix=" ", Scroller_Radix=7, Scroller_Value=16)

number_slider_27 = Slider(1, range=0..1)
end_points_19 = EndPoints(Curve=curve_122)  # -> Start, End
rectangle_2pt_19 = Rectangle2Pt(Plane=PlaneXY(0, 0, 0), PointA=end_points_19.Start, PointB=end_points_19.End, Radius=0)  # -> Rectangle, Length

series_13 = Series(Start=0, Step=panel_257, Count=number_26)
expression_167 = Expression(O=series_13, Expression="FORMAT(\"{0:R}\",O)")  # disabled
panel_258 = Panel(expression_167)
bounds_12 = Bounds(Numbers=series_13)
expression_168 = Expression(X=number_26, Expression="1/X")
duplicate_data_15 = DuplicateData(Data=expression_168, Number=number_26, Order=True)

curve_graph_mapper_12 = CurveGraphMapper(Curves=curve_122, Rectangle=rectangle_2pt_19.Rectangle, Values=series_13, Flip=False, Snap=True, TextSize=0.015625)  # -> Mapped, GraphCurves, GraphPoints, ValueLines, ValuePoints, MappedLines, MappedPoints, Boundary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; disabled
graphmapper_12 = GraphMapper(Curve=curve_122, Boundary=rectangle_2pt_19.Rectangle, Numbers=series_13, Input=bounds_12, Output=bounds_12, bobo=False)
stream_filter_25 = StreamFilter(Gate=number_slider_23, Stream0=curve_graph_mapper_12.Mapped, Stream1=graphmapper_12)

turtle_13 = DotNETVBScriptLEGACY(Forward=duplicate_data_15, Left=stream_filter_25)  # -> Output, Points; inputs Forward: list, Left: list; same code as turtle

expression_169 = Expression(O=turtle_13.Points, Expression="FORMAT(\"{0:R}\",O)")
panel_259 = Panel(expression_169)

point_24 = Point(turtle_13.Points)
scale_53 = Scale(Geometry=point_24, Center=Point(0, 0, 0), Factor=expr("2^X", digit_scroller_97))  # -> Geometry, Transform

interpolate_t_13 = InterpolateT(Vertices=scale_53.Geometry, TangentStart=Vector(0.0625, 0, 0), TangentEnd=Vector(0, 0, 0), KnotStyle=2)  # -> Curve, Length, Domain
evaluate_length_50 = EvaluateLength(Curve=interpolate_t_13.Curve, Length=1, Normalized=True)  # -> Point, Tangent, Parameter
line_sdl_17 = LineSDL(Start=evaluate_length_50.Point, Direction=evaluate_length_50.Tangent, Length=1)
mirror_25 = Mirror(Geometry=interpolate_t_13.Curve, Plane=line_sdl_17)  # -> Geometry, Transform
join_curves_27 = JoinCurves(Curves=[interpolate_t_13.Curve, mirror_25.Geometry], Preserve=False)
evaluate_length_51 = EvaluateLength(Curve=join_curves_27, Length=1, Normalized=True)  # -> Point, Tangent, Parameter
rotate_14 = Rotate(Geometry=join_curves_27, Angle=3.141592654, Plane=evaluate_length_51.Point)  # -> Geometry, Transform
join_curves_28 = JoinCurves(Curves=[join_curves_27, rotate_14.Geometry], Preserve=False)
curve_125 = Curve(join_curves_28)

evaluate_length_52 = EvaluateLength(Curve=join_curves_28, Length=1, Normalized=True)  # -> Point, Tangent, Parameter
deconstruct_29 = Deconstruct(Point=evaluate_length_52.Point)  # -> XComponent, YComponent, ZComponent
expression_170 = Expression(O=deconstruct_29.YComponent, Expression="FORMAT(\"{0:R}\",O)")
expression_171 = Expression(O=deconstruct_29.XComponent, Expression="FORMAT(\"{0:R}\",O)")
expression_172 = Expression(O=deconstruct_29.ZComponent, Expression="FORMAT(\"{0:R}\",O)")
panel_260 = Panel(expression_170)
panel_261 = Panel(expression_171)
panel_262 = Panel(expression_172)
addition_13 = Addition(A=panel_260, B=panel_261)
expression_173 = Expression(O=addition_13, Expression="FORMAT(\"{0:R}\",O)")
panel_263 = Panel(expression_173)
division_25 = Division(A=panel_263, B=2)
expression_174 = Expression(O=division_25, Expression="FORMAT(\"{0:R}\",O)")
panel_264 = Panel(expression_174)
scale_54 = Scale(Geometry=scale_53.Geometry, Center=Point(0, 0, 0), Factor=expr("1/X", panel_264))  # -> Geometry, Transform
scale_55 = Scale(Geometry=curve_125, Center=Point(0, 0, 0), Factor=expr("1/X", panel_264))  # -> Geometry, Transform
evaluate_length_53 = EvaluateLength(Curve=scale_55.Geometry, Length=1, Normalized=True)  # -> Point, Tangent, Parameter
deconstruct_30 = Deconstruct(Point=evaluate_length_53.Point)  # -> XComponent, YComponent, ZComponent
expression_175 = Expression(O=deconstruct_30.YComponent, Expression="FORMAT(\"{0:R}\",O)")
expression_176 = Expression(O=deconstruct_30.XComponent, Expression="FORMAT(\"{0:R}\",O)")
expression_177 = Expression(O=deconstruct_30.ZComponent, Expression="FORMAT(\"{0:R}\",O)")
panel_265 = Panel(expression_175)
panel_266 = Panel(expression_176)
panel_267 = Panel(expression_177)
division_26 = Division(A=panel_261, B=panel_260)
expression_178 = Expression(O=division_26, Expression="FORMAT(\"{0:R}\",O)")
panel_268 = Panel(expression_178)
curve_126 = Curve(scale_55.Geometry)
point_25 = Point(scale_54.Geometry)

move_22 = Move(Geometry=curve_126, Motion=Vector(17.5, 0, 0))  # -> Geometry, Transform
mirror_26 = Mirror(Geometry=curve_126, Plane=PlaneYZ(0, 0, 0))  # -> Geometry, Transform; disabled
curve_127 = Curve(move_22.Geometry)

entwine = Entwine(
    Branch0X=curve_34,
    Branch1X=curve_47,
    Branch2X=curve_60,
    Branch3X=curve_73,
    Branch4X=curve_86,
    Branch5X=curve_105,
    Branch6X=curve_116,
    Branch7X=curve_127,
    FlattenInputs=False)

vector_xyz_11 = VectorXYZ(XComponent=17.5, YComponent=1.5, ZComponent=0)  # -> Vector, Length
curve_128 = Curve(curve_126)
end_points_20 = EndPoints(Curve=curve_128)  # -> Start, End
rectangle_2pt_20 = Rectangle2Pt(Plane=PlaneXY(0, 0, 0), PointA=end_points_20.Start, PointB=end_points_20.End, Radius=0)  # -> Rectangle, Length
deconstuct_rectangle_8 = DeconstuctRectangle(Rectangle=rectangle_2pt_20.Rectangle)  # -> BasePlane, XInterval, YInterval
deconstruct_domain_17 = DeconstructDomain(Domain=deconstuct_rectangle_8.YInterval)  # -> Start, End
deconstruct_domain_18 = DeconstructDomain(Domain=deconstuct_rectangle_8.XInterval)  # -> Start, End
scale_nu_8 = ScaleNU(
    Geometry=curve_126,
    Plane=PlaneXY(0, 0, 0),
    ScaleX=expr("1/X", deconstruct_domain_18.End),
    ScaleY=expr("1/X", deconstruct_domain_17.End),
    ScaleZ=1)  # -> Geometry, Transform
curve_129 = Curve(scale_nu_8.Geometry)
move_23 = Move(Geometry=curve_129, Motion=vector_xyz_11.Vector)  # -> Geometry, Transform
curve_130 = Curve(move_23.Geometry)

entwine_2 = Entwine(
    Branch0X=curve_39,
    Branch1X=curve_50,
    Branch2X=curve_63,
    Branch3X=curve_76,
    Branch4X=curve_89,
    Branch5X=curve_108,
    Branch6X=curve_119,
    Branch7X=curve_130,
    FlattenInputs=False)
entwine_3 = Entwine(Branch0X=entwine_2, Branch1X=entwine, FlattenInputs=False)

digit_scroller_98 = DigitScroller(Scroller_Digits=12, Scroller_Prefix=" ", Scroller_Radix=2, Scroller_Value=30.9312132)
stream_filter_26 = StreamFilter(Gate=number_slider_22, Stream0=curve_126, Stream1=curve_129)
curve_131 = Curve(stream_filter_26)
scale_56 = Scale(Geometry=curve_131, Center=Point(0, 0, 0), Factor=expr("2^X", number))  # -> Geometry, Transform
curve_132 = Curve(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)
curve_133 = Curve(scale_56.Geometry)
curve_134 = Curve(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)

digit_scroller_99 = DigitScroller(Scroller_Digits=12, Scroller_Prefix="Digit Scroller", Scroller_Radix=1, Scroller_Value=0.00140149998)
radians_14 = Radians(Degrees="0.001373312102167")
number_slider_28 = Slider(256, range=0..65536)

expression_179 = Expression(O=radians_14, Expression="FORMAT(\"{0:0.00000000000000000000}\",O)")
panel_273 = Panel(expression_179)
curve_135 = Curve(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)
number_27 = Number(number_5)

digit_scroller_100 = DigitScroller(Scroller_Digits=12, Scroller_Prefix=" ", Scroller_Radix=7, Scroller_Value=16)

deconstruct_vector = DeconstructVector(Vector=vector_xyz_11.Vector)  # -> XComponent, YComponent, ZComponent
vector_xyz_12 = VectorXYZ(
    XComponent=deconstruct_vector.XComponent,
    YComponent=expr("X+2.5", deconstruct_vector.YComponent),
    ZComponent=deconstruct_vector.ZComponent)  # -> Vector, Length

number_slider_29 = Slider(1, range=0..1)
end_points_21 = EndPoints(Curve=curve_133)  # -> Start, End
rectangle_2pt_21 = Rectangle2Pt(Plane=PlaneXY(0, 0, 0), PointA=end_points_21.Start, PointB=end_points_21.End, Radius=0)  # -> Rectangle, Length

series_14 = Series(Start=0, Step=panel_273, Count=number_27)
expression_180 = Expression(O=series_14, Expression="FORMAT(\"{0:R}\",O)")  # disabled
panel_274 = Panel(expression_180)
bounds_13 = Bounds(Numbers=series_14)
expression_181 = Expression(X=number_27, Expression="1/X")
duplicate_data_16 = DuplicateData(Data=expression_181, Number=number_27, Order=True)

curve_graph_mapper_13 = CurveGraphMapper(Curves=curve_133, Rectangle=rectangle_2pt_21.Rectangle, Values=series_14, Flip=False, Snap=True, TextSize=0.015625)  # -> Mapped, GraphCurves, GraphPoints, ValueLines, ValuePoints, MappedLines, MappedPoints, Boundary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; disabled
graphmapper_13 = GraphMapper(Curve=curve_133, Boundary=rectangle_2pt_21.Rectangle, Numbers=series_14, Input=bounds_13, Output=bounds_13, bobo=False)
stream_filter_27 = StreamFilter(Gate=number_slider_23, Stream0=curve_graph_mapper_13.Mapped, Stream1=graphmapper_13)

turtle_14 = DotNETVBScriptLEGACY(Forward=duplicate_data_16, Left=stream_filter_27)  # -> Output, Points; inputs Forward: list, Left: list; same code as turtle

expression_182 = Expression(O=turtle_14.Points, Expression="FORMAT(\"{0:R}\",O)")
panel_275 = Panel(expression_182)

point_26 = Point(turtle_14.Points)
scale_57 = Scale(Geometry=point_26, Center=Point(0, 0, 0), Factor=expr("2^X", digit_scroller_100))  # -> Geometry, Transform

interpolate_t_14 = InterpolateT(Vertices=scale_57.Geometry, TangentStart=Vector(0.0625, 0, 0), TangentEnd=Vector(0, 0, 0), KnotStyle=2)  # -> Curve, Length, Domain
evaluate_length_54 = EvaluateLength(Curve=interpolate_t_14.Curve, Length=1, Normalized=True)  # -> Point, Tangent, Parameter
line_sdl_18 = LineSDL(Start=evaluate_length_54.Point, Direction=evaluate_length_54.Tangent, Length=1)
mirror_27 = Mirror(Geometry=interpolate_t_14.Curve, Plane=line_sdl_18)  # -> Geometry, Transform
join_curves_29 = JoinCurves(Curves=[interpolate_t_14.Curve, mirror_27.Geometry], Preserve=False)
evaluate_length_55 = EvaluateLength(Curve=join_curves_29, Length=1, Normalized=True)  # -> Point, Tangent, Parameter
rotate_15 = Rotate(Geometry=join_curves_29, Angle=3.141592654, Plane=evaluate_length_55.Point)  # -> Geometry, Transform
join_curves_30 = JoinCurves(Curves=[join_curves_29, rotate_15.Geometry], Preserve=False)
curve_136 = Curve(join_curves_30)

evaluate_length_56 = EvaluateLength(Curve=join_curves_30, Length=1, Normalized=True)  # -> Point, Tangent, Parameter
deconstruct_31 = Deconstruct(Point=evaluate_length_56.Point)  # -> XComponent, YComponent, ZComponent
expression_183 = Expression(O=deconstruct_31.YComponent, Expression="FORMAT(\"{0:R}\",O)")
expression_184 = Expression(O=deconstruct_31.XComponent, Expression="FORMAT(\"{0:R}\",O)")
expression_185 = Expression(O=deconstruct_31.ZComponent, Expression="FORMAT(\"{0:R}\",O)")
panel_276 = Panel(expression_183)
panel_277 = Panel(expression_184)
panel_278 = Panel(expression_185)
addition_14 = Addition(A=panel_276, B=panel_277)
expression_186 = Expression(O=addition_14, Expression="FORMAT(\"{0:R}\",O)")
panel_279 = Panel(expression_186)
division_27 = Division(A=panel_279, B=2)
expression_187 = Expression(O=division_27, Expression="FORMAT(\"{0:R}\",O)")
panel_280 = Panel(expression_187)
scale_58 = Scale(Geometry=scale_57.Geometry, Center=Point(0, 0, 0), Factor=expr("1/X", panel_280))  # -> Geometry, Transform
scale_59 = Scale(Geometry=curve_136, Center=Point(0, 0, 0), Factor=expr("1/X", panel_280))  # -> Geometry, Transform
evaluate_length_57 = EvaluateLength(Curve=scale_59.Geometry, Length=1, Normalized=True)  # -> Point, Tangent, Parameter
deconstruct_32 = Deconstruct(Point=evaluate_length_57.Point)  # -> XComponent, YComponent, ZComponent
expression_188 = Expression(O=deconstruct_32.YComponent, Expression="FORMAT(\"{0:R}\",O)")
expression_189 = Expression(O=deconstruct_32.XComponent, Expression="FORMAT(\"{0:R}\",O)")
expression_190 = Expression(O=deconstruct_32.ZComponent, Expression="FORMAT(\"{0:R}\",O)")
panel_281 = Panel(expression_188)
panel_282 = Panel(expression_189)
panel_283 = Panel(expression_190)
division_28 = Division(A=panel_277, B=panel_276)
expression_191 = Expression(O=division_28, Expression="FORMAT(\"{0:R}\",O)")
panel_284 = Panel(expression_191)
curve_137 = Curve(scale_59.Geometry)
point_27 = Point(scale_58.Geometry)

move_24 = Move(Geometry=curve_137, Motion=vector_xyz_12.Vector)  # -> Geometry, Transform
mirror_28 = Mirror(Geometry=curve_137, Plane=PlaneYZ(0, 0, 0))  # -> Geometry, Transform; disabled
curve_138 = Curve(move_24.Geometry)

entwine_4 = Entwine(
    Branch0X=curve_138,
    Branch1X=curve_44,
    Branch2X=curve_57,
    Branch3X=curve_70,
    Branch4X=curve_83,
    Branch5X=curve_101,
    FlattenInputs=False)
entwine_5 = Entwine(Branch0X=entwine_4, Branch1X=entwine_3, FlattenInputs=False)
curve_139 = Curve(graft(entwine_5))

curve_140 = Curve(entwine_4)
curve_141 = Curve(entwine_5)

curve_142 = Curve(graft(curve_139))  # disabled
divide_curve_5 = DivideCurve(Curve=curve_142, Count=number_9, Kinks=False)  # -> Points, Tangents, Parameters
curvature = Curvature(Curve=curve_142, Parameter=divide_curve_5.Parameters)  # -> Point, Curvature, Curvature_2
deconstruct_arc = DeconstructArc(Arc=curvature.Curvature_2)  # -> BasePlane, Radius, Angle
expression_192 = Expression(O=deconstruct_arc.Radius, Expression="FORMAT(\"{0:R}\",O)")  # disabled
panel_286 = Panel(expression_192)
quick_graph = QuickGraph(deconstruct_arc.Radius, SortOrder=0)
one_over_x = OneOverX(Value=deconstruct_arc.Radius)

expression_193 = Expression(O=one_over_x, Expression="FORMAT(\"{0:R}\",O)")  # disabled
panel_287 = Panel(expression_193)

quick_graph_2 = QuickGraph(one_over_x, SortOrder=0)
multiplication = Multiplication(A=one_over_x, B=digit_scroller_38)
line_sdl_19 = LineSDL(Start=divide_curve.Points, Direction=Vector(0, 1, 0), Length=multiplication)

replace_nulls = ReplaceNulls(Items=one_over_x, Replacements=0)  # -> Items, Count
relative_differences = RelativeDifferences(Values=replace_nulls.Items)

curve_143 = Curve(line_sdl_19)

list_length_4 = ListLength(List=curve_142)  # -> flatten(Length)
mass_addition = MassAddition(Input=list_length_4)  # -> Result, PartialResults
panel_288 = Panel(mass_addition.Result)
series_15 = Series(Start=1, Step=1, Count=panel_288)  # -> graft(Series)
vector_xyz_13 = VectorXYZ(XComponent=expr("-X", series_15), YComponent=0, ZComponent=0)  # -> Vector, Length
move_25 = Move(Geometry=curve_143, Motion=vector_xyz_13.Vector)  # -> Geometry, Transform
evaluate_length_58 = EvaluateLength(Curve=move_25.Geometry, Length=1, Normalized=True)  # -> Point, Tangent, Parameter
interpolate = Interpolate(Vertices=evaluate_length_58.Point, Degree=1, Periodic=False, KnotStyle=2)  # -> Curve, Length, Domain

expression_194 = Expression(O=relative_differences, Expression="FORMAT(\"{0:R}\",O)")  # disabled
panel_289 = Panel(expression_194)
vector_xyz_14 = VectorXYZ(XComponent=expr("-X", series_15), YComponent=1, ZComponent=0)  # -> Vector, Length
quick_graph_3 = QuickGraph(relative_differences, SortOrder=0)
multiplication_2 = Multiplication(A=relative_differences, B=digit_scroller_40)
line_sdl_20 = LineSDL(Start=divide_curve.Points, Direction=Vector(0, 1, 0), Length=multiplication_2)
move_26 = Move(Geometry=line_sdl_20, Motion=vector_xyz_14.Vector)  # -> Geometry, Transform
evaluate_length_59 = EvaluateLength(Curve=move_26.Geometry, Length=1, Normalized=True)  # -> Point, Tangent, Parameter
interpolate_2 = Interpolate(Vertices=evaluate_length_59.Point, Degree=1, Periodic=False, KnotStyle=2)  # -> Curve, Length, Domain

vector_xyz_15 = VectorXYZ(XComponent=expr("-X", series_15), YComponent=2, ZComponent=0)  # -> Vector, Length
replace_nulls_2 = ReplaceNulls(Items=relative_differences, Replacements=0)  # -> Items, Count
relative_differences_2 = RelativeDifferences(Values=replace_nulls_2.Items)
expression_195 = Expression(O=relative_differences_2, Expression="FORMAT(\"{0:R}\",O)")  # disabled
panel_290 = Panel(expression_195)
quick_graph_4 = QuickGraph(relative_differences_2, SortOrder=0)
multiplication_3 = Multiplication(A=relative_differences_2, B=digit_scroller_37)
line_sdl_21 = LineSDL(Start=divide_curve.Points, Direction=Vector(0, 1, 0), Length=multiplication_3)
move_27 = Move(Geometry=line_sdl_21, Motion=vector_xyz_15.Vector)  # -> Geometry, Transform
evaluate_length_60 = EvaluateLength(Curve=move_27.Geometry, Length=1, Normalized=True)  # -> Point, Tangent, Parameter
interpolate_3 = Interpolate(Vertices=evaluate_length_60.Point, Degree=1, Periodic=False, KnotStyle=2)  # -> Curve, Length, Domain

vector_xyz_16 = VectorXYZ(XComponent=expr("-X", series_15), YComponent=3, ZComponent=0)  # -> Vector, Length
replace_nulls_3 = ReplaceNulls(Items=relative_differences_2, Replacements=0)  # -> Items, Count
relative_differences_3 = RelativeDifferences(Values=replace_nulls_3.Items)
expression_196 = Expression(O=relative_differences_3, Expression="FORMAT(\"{0:R}\",O)")  # disabled
panel_291 = Panel(expression_196)
quick_graph_5 = QuickGraph(relative_differences_3, SortOrder=0)
multiplication_4 = Multiplication(A=relative_differences_3, B=digit_scroller_36)
line_sdl_22 = LineSDL(Start=divide_curve.Points, Direction=Vector(0, 1, 0), Length=multiplication_4)  # disabled
move_28 = Move(Geometry=line_sdl_22, Motion=vector_xyz_16.Vector)  # -> Geometry, Transform
evaluate_length_61 = EvaluateLength(Curve=move_28.Geometry, Length=1, Normalized=True)  # -> Point, Tangent, Parameter
interpolate_4 = Interpolate(Vertices=evaluate_length_61.Point, Degree=1, Periodic=False, KnotStyle=2)  # -> Curve, Length, Domain

vector_xyz_17 = VectorXYZ(XComponent=expr("-X", series_15), YComponent=4, ZComponent=0)  # -> Vector, Length
replace_nulls_4 = ReplaceNulls(Items=relative_differences_3, Replacements=0)  # -> Items, Count
relative_differences_4 = RelativeDifferences(Values=replace_nulls_4.Items)
expression_197 = Expression(O=relative_differences_4, Expression="FORMAT(\"{0:R}\",O)")  # disabled
panel_292 = Panel(expression_197)
quick_graph_6 = QuickGraph(relative_differences_4, SortOrder=0)
multiplication_5 = Multiplication(A=relative_differences_4, B=digit_scroller_35)
line_sdl_23 = LineSDL(Start=divide_curve.Points, Direction=Vector(0, 1, 0), Length=multiplication_5)  # disabled
move_29 = Move(Geometry=line_sdl_23, Motion=vector_xyz_17.Vector)  # -> Geometry, Transform
evaluate_length_62 = EvaluateLength(Curve=move_29.Geometry, Length=1, Normalized=True)  # -> Point, Tangent, Parameter
interpolate_5 = Interpolate(Vertices=evaluate_length_62.Point, Degree=1, Periodic=False, KnotStyle=2)  # -> Curve, Length, Domain

vector_xyz_18 = VectorXYZ(XComponent=expr("-X", series_15), YComponent=5, ZComponent=0)  # -> Vector, Length
replace_nulls_5 = ReplaceNulls(Items=relative_differences_4, Replacements=0)  # -> Items, Count
relative_differences_5 = RelativeDifferences(Values=replace_nulls_5.Items)
expression_198 = Expression(O=relative_differences_5, Expression="FORMAT(\"{0:R}\",O)")  # disabled
panel_293 = Panel(expression_198)
quick_graph_7 = QuickGraph(relative_differences_5, SortOrder=0)
multiplication_6 = Multiplication(A=relative_differences_5, B=digit_scroller_41)
line_sdl_24 = LineSDL(Start=divide_curve.Points, Direction=Vector(0, 1, 0), Length=multiplication_6)  # disabled
move_30 = Move(Geometry=line_sdl_24, Motion=vector_xyz_18.Vector)  # -> Geometry, Transform
evaluate_length_63 = EvaluateLength(Curve=move_30.Geometry, Length=1, Normalized=True)  # -> Point, Tangent, Parameter
interpolate_6 = Interpolate(Vertices=evaluate_length_63.Point, Degree=1, Periodic=False, KnotStyle=2)  # -> Curve, Length, Domain

replace_nulls_6 = ReplaceNulls(Items=relative_differences_5, Replacements=0)  # -> Items, Count
relative_differences_6 = RelativeDifferences(Values=replace_nulls_6.Items)

expression_199 = Expression(O=relative_differences_6, Expression="FORMAT(\"{0:R}\",O)")  # disabled
panel_294 = Panel(expression_199)
vector_xyz_19 = VectorXYZ(XComponent=expr("-X", series_15), YComponent=6, ZComponent=0)  # -> Vector, Length
quick_graph_8 = QuickGraph(relative_differences_6, SortOrder=0)
multiplication_7 = Multiplication(A=relative_differences_6, B=digit_scroller_42)
line_sdl_25 = LineSDL(Start=divide_curve.Points, Direction=Vector(0, 1, 0), Length=multiplication_7)  # disabled
move_31 = Move(Geometry=line_sdl_25, Motion=vector_xyz_19.Vector)  # -> Geometry, Transform
evaluate_length_64 = EvaluateLength(Curve=move_31.Geometry, Length=1, Normalized=True)  # -> Point, Tangent, Parameter
interpolate_7 = Interpolate(Vertices=evaluate_length_64.Point, Degree=1, Periodic=False, KnotStyle=2)  # -> Curve, Length, Domain

vector_xyz_20 = VectorXYZ(XComponent=expr("-X", series_15), YComponent=7, ZComponent=0)  # -> Vector, Length
replace_nulls_7 = ReplaceNulls(Items=relative_differences_6, Replacements=0)  # -> Items, Count
relative_differences_7 = RelativeDifferences(Values=replace_nulls_7.Items)
expression_200 = Expression(O=relative_differences_7, Expression="FORMAT(\"{0:R}\",O)")  # disabled
panel_295 = Panel(expression_200)
quick_graph_9 = QuickGraph(relative_differences_7, SortOrder=0)
multiplication_8 = Multiplication(A=relative_differences_7, B=digit_scroller_39)
line_sdl_26 = LineSDL(Start=divide_curve.Points, Direction=Vector(0, 1, 0), Length=multiplication_8)  # disabled
move_32 = Move(Geometry=line_sdl_26, Motion=vector_xyz_20.Vector)  # -> Geometry, Transform
evaluate_length_65 = EvaluateLength(Curve=move_32.Geometry, Length=1, Normalized=True)  # -> Point, Tangent, Parameter
interpolate_8 = Interpolate(Vertices=evaluate_length_65.Point, Degree=1, Periodic=False, KnotStyle=2)  # -> Curve, Length, Domain

vector_xyz_21 = VectorXYZ(XComponent=expr("-X", series_15), YComponent=8, ZComponent=0)  # -> Vector, Length
replace_nulls_8 = ReplaceNulls(Items=relative_differences_7, Replacements=0)  # -> Items, Count
relative_differences_8 = RelativeDifferences(Values=replace_nulls_8.Items)
expression_201 = Expression(O=relative_differences_8, Expression="FORMAT(\"{0:R}\",O)")  # disabled
panel_296 = Panel(expression_201)
quick_graph_10 = QuickGraph(relative_differences_8, SortOrder=0)
multiplication_9 = Multiplication(A=relative_differences_8, B=digit_scroller_43)
line_sdl_27 = LineSDL(Start=divide_curve.Points, Direction=Vector(0, 1, 0), Length=multiplication_9)  # disabled
move_33 = Move(Geometry=line_sdl_27, Motion=vector_xyz_21.Vector)  # -> Geometry, Transform
evaluate_length_66 = EvaluateLength(Curve=move_33.Geometry, Length=1, Normalized=True)  # -> Point, Tangent, Parameter
interpolate_9 = Interpolate(Vertices=evaluate_length_66.Point, Degree=1, Periodic=False, KnotStyle=2)  # -> Curve, Length, Domain

custom_preview = CustomPreview(Geometry=interpolate_5.Curve, Material=create_material)

custom_preview_2 = CustomPreview(Geometry=move_29.Geometry, Material=create_material_2)

custom_preview_3 = CustomPreview(Geometry=interpolate_4.Curve, Material=create_material_3)

custom_preview_4 = CustomPreview(Geometry=move_28.Geometry, Material=create_material_4)

custom_preview_5 = CustomPreview(Geometry=interpolate_3.Curve, Material=create_material_5)

custom_preview_6 = CustomPreview(Geometry=move_27.Geometry, Material=create_material_6)

custom_preview_7 = CustomPreview(Geometry=interpolate_2.Curve, Material=create_material_7)

custom_preview_8 = CustomPreview(Geometry=move_26.Geometry, Material=create_material_8)

custom_preview_9 = CustomPreview(Geometry=interpolate.Curve, Material=create_material_9)

custom_preview_10 = CustomPreview(Geometry=move_25.Geometry, Material=create_material_10)

custom_preview_11 = CustomPreview(Geometry=interpolate_9.Curve, Material=create_material_11)

custom_preview_12 = CustomPreview(Geometry=move_33.Geometry, Material=create_material_12)

custom_preview_13 = CustomPreview(Geometry=interpolate_8.Curve, Material=create_material_13)

custom_preview_14 = CustomPreview(Geometry=move_32.Geometry, Material=create_material_14)

custom_preview_15 = CustomPreview(Geometry=interpolate_6.Curve, Material=create_material_15)

custom_preview_16 = CustomPreview(Geometry=move_30.Geometry, Material=create_material_16)

custom_preview_17 = CustomPreview(Geometry=interpolate_7.Curve, Material=create_material_17)

custom_preview_18 = CustomPreview(Geometry=move_31.Geometry, Material=create_material_18)

curve_144 = Curve(graft(curve_139))
divide_curve_6 = DivideCurve(Curve=curve_144, Count=number_12, Kinks=False)  # -> Points, Tangents, Parameters
curvature_2 = Curvature(Curve=curve_144, Parameter=divide_curve_6.Parameters)  # -> Point, Curvature, Curvature_2
deconstruct_arc_2 = DeconstructArc(Arc=curvature_2.Curvature_2)  # -> BasePlane, Radius, Angle
line = Line(StartPoint=curvature_2.Point, EndPoint=deconstruct_arc_2.BasePlane)
one_over_x_2 = OneOverX(Value=deconstruct_arc_2.Radius)
quick_graph_11 = QuickGraph(one_over_x_2, SortOrder=0)
replace_nulls_9 = ReplaceNulls(Items=one_over_x_2, Replacements=0)  # -> Items, Count
relative_differences_9 = RelativeDifferences(Values=replace_nulls_9.Items)
curvature_graph = CurvatureGraph(Curve=curve_144, Density=1, Scale=digit_scroller_58)  # disabled
custom_preview_19 = CustomPreview(Geometry=curve_144, Material=create_material_21)

expression_202 = Expression(O=relative_differences_9, Expression="FORMAT(\"{0:R}\",O)")  # disabled
panel_297 = Panel(expression_202)
quick_graph_12 = QuickGraph(relative_differences_9, SortOrder=0)

expression_203 = Expression(O=one_over_x_2, Expression="FORMAT(\"{0:R}\",O)")  # disabled
panel_298 = Panel(expression_203)

expression_204 = Expression(O=deconstruct_arc_2.Radius, Expression="FORMAT(\"{0:R}\",O)")  # disabled
panel_299 = Panel(expression_204)

derivatives = Derivatives(Curve=curve_144, Parameter=divide_curve_6.Parameters)  # -> Point, FirstDerivative, SecondDerivative, ThirdDerivative, FourthDerivative, FifthDerivative, SixthDerivative; disabled
quick_graph_13 = QuickGraph(derivatives.SixthDerivative, SortOrder=0)
quick_graph_14 = QuickGraph(derivatives.FifthDerivative, SortOrder=0)
quick_graph_15 = QuickGraph(derivatives.FourthDerivative, SortOrder=0)
quick_graph_16 = QuickGraph(derivatives.ThirdDerivative, SortOrder=0)
quick_graph_17 = QuickGraph(derivatives.SecondDerivative, SortOrder=0)
quick_graph_18 = QuickGraph(derivatives.FirstDerivative, SortOrder=0)
quick_graph_19 = QuickGraph(derivatives.Point, SortOrder=0)
length = Length(Curve=curve_144)

relative_differences_10 = RelativeDifferences(Values=relative_differences_9)

quick_graph_20 = QuickGraph(relative_differences_10, SortOrder=0)
bounds_14 = Bounds(Numbers=relative_differences_10)
remap_numbers = RemapNumbers(Value=relative_differences_10, Source=bounds_14, Target=Domain(-1, 1))  # -> Mapped, Clipped
multiplication_10 = Multiplication(A=remap_numbers.Mapped, B=length)
multiplication_11 = Multiplication(A=multiplication_10, B=digit_scroller_59)

relative_differences_11 = RelativeDifferences(Values=relative_differences_10)

quick_graph_21 = QuickGraph(relative_differences_11, SortOrder=0)

relative_differences_12 = RelativeDifferences(Values=relative_differences_11)

quick_graph_22 = QuickGraph(relative_differences_12, SortOrder=0)
bounds_15 = Bounds(Numbers=relative_differences_12)
remap_numbers_2 = RemapNumbers(Value=relative_differences_12, Source=bounds_15, Target=Domain(-1, 1))  # -> Mapped, Clipped
multiplication_12 = Multiplication(A=remap_numbers_2.Mapped, B=length)
multiplication_13 = Multiplication(A=multiplication_12, B=digit_scroller_5)

relative_differences_13 = RelativeDifferences(Values=relative_differences_12)

relative_differences_14 = RelativeDifferences(Values=relative_differences_13)

quick_graph_23 = QuickGraph(relative_differences_14, SortOrder=0)
bounds_16 = Bounds(Numbers=relative_differences_14)
remap_numbers_3 = RemapNumbers(Value=relative_differences_14, Source=bounds_16, Target=Domain(-1, 1))  # -> Mapped, Clipped
multiplication_14 = Multiplication(A=remap_numbers_3.Mapped, B=length)
multiplication_15 = Multiplication(A=multiplication_14, B=digit_scroller_4)

relative_differences_15 = RelativeDifferences(Values=relative_differences_14)

quick_graph_24 = QuickGraph(relative_differences_15, SortOrder=0)
bounds_17 = Bounds(Numbers=relative_differences_15)
remap_numbers_4 = RemapNumbers(Value=relative_differences_15, Source=bounds_17, Target=Domain(-1, 1))  # -> Mapped, Clipped
multiplication_16 = Multiplication(A=remap_numbers_4.Mapped, B=length)
multiplication_17 = Multiplication(A=multiplication_16, B=digit_scroller_54)

relative_differences_16 = RelativeDifferences(Values=relative_differences_15)

quick_graph_25 = QuickGraph(relative_differences_16, SortOrder=0)
bounds_18 = Bounds(Numbers=relative_differences_16)
remap_numbers_5 = RemapNumbers(Value=relative_differences_16, Source=bounds_18, Target=Domain(-1, 1))  # -> Mapped, Clipped
multiplication_18 = Multiplication(A=remap_numbers_5.Mapped, B=length)
multiplication_19 = Multiplication(A=multiplication_18, B=digit_scroller_3)

quick_graph_26 = QuickGraph(relative_differences_13, SortOrder=0)
bounds_19 = Bounds(Numbers=relative_differences_13)
remap_numbers_6 = RemapNumbers(Value=relative_differences_13, Source=bounds_19, Target=Domain(-1, 1))  # -> Mapped, Clipped
multiplication_20 = Multiplication(A=remap_numbers_6.Mapped, B=length)
multiplication_21 = Multiplication(A=multiplication_20, B=digit_scroller_6)

bounds_20 = Bounds(Numbers=relative_differences_11)
remap_numbers_7 = RemapNumbers(Value=relative_differences_11, Source=bounds_20, Target=Domain(-1, 1))  # -> Mapped, Clipped

bounds_21 = Bounds(Numbers=relative_differences_9)
remap_numbers_8 = RemapNumbers(Value=relative_differences_9, Source=bounds_21, Target=Domain(-1, 1))  # -> Mapped, Clipped

bounds_22 = Bounds(Numbers=one_over_x_2)
remap_numbers_9 = RemapNumbers(Value=one_over_x_2, Source=bounds_22, Target=Domain(0, 1))  # -> Mapped, Clipped

multiplication_22 = Multiplication(A=remap_numbers_7.Mapped, B=length)

multiplication_23 = Multiplication(A=multiplication_22, B=digit_scroller_56)

multiplication_24 = Multiplication(A=remap_numbers_8.Mapped, B=length)
multiplication_25 = Multiplication(A=length, B=remap_numbers_9.Mapped)

multiplication_26 = Multiplication(A=multiplication_24, B=digit_scroller_60)

multiplication_27 = Multiplication(A=multiplication_25, B=digit_scroller_55)

line_sdl_28 = LineSDL(Start=curvature_2.Point, Direction=line, Length=expr("-X", multiplication_27))
evaluate_length_67 = EvaluateLength(Curve=line_sdl_28, Length=1, Normalized=True)  # -> Point, Tangent, Parameter
interpolate_10 = Interpolate(Vertices=evaluate_length_67.Point, Degree=1, Periodic=False, KnotStyle=2)  # -> Curve, Length, Domain
custom_preview_20 = CustomPreview(Geometry=line_sdl_28, Material=create_material_20)
curve_145 = Curve(interpolate_10.Curve)
custom_preview_21 = CustomPreview(Geometry=curve_145, Material=create_material_19)

line_sdl_29 = LineSDL(Start=evaluate_length_67.Point, Direction=line_sdl_28, Length=expr("ABS(X)", multiplication_26))
nurbs_curve = NurbsCurve(Vertices=evaluate_length_67.Point, Degree=3, Periodic=False)  # -> Curve, Length, Domain; disabled
custom_preview_22 = CustomPreview(Geometry=line_sdl_29, Material=create_material_25)
curve_146 = Curve(line_sdl_29)
evaluate_length_68 = EvaluateLength(Curve=curve_146, Length=1, Normalized=True)  # -> Point, Tangent, Parameter
line_sdl_30 = LineSDL(Start=evaluate_length_68.Point, Direction=derivatives.ThirdDerivative, Length=expr("-X", multiplication_26))
evaluate_length_69 = EvaluateLength(Curve=line_sdl_30, Length=1, Normalized=True)  # -> Point, Tangent, Parameter
interpolate_11 = Interpolate(Vertices=evaluate_length_69.Point, Degree=3, Periodic=False, KnotStyle=2)  # -> Curve, Length, Domain
custom_preview_23 = CustomPreview(Geometry=interpolate_11.Curve, Material=create_material_22)
custom_preview_24 = CustomPreview(Geometry=line_sdl_30, Material=create_material_23)
interpolate_12 = Interpolate(Vertices=evaluate_length_68.Point, Degree=1, Periodic=False, KnotStyle=2)  # -> Curve, Length, Domain
polyline = PolyLine(Vertices=evaluate_length_68.Point, Closed=False)
explode = Explode(Curve=polyline, Recursive=True)  # -> Segments, Vertices
custom_preview_25 = CustomPreview(Geometry=interpolate_12.Curve, Material=create_material_24)
curve_147 = Curve(flatten(explode.Segments))
length_2 = Length(Curve=curve_147)
sort_list = SortList(Keys=length_2, ValuesValuesA=curve_147)  # -> Keys, ValuesValuesA
list_item_2 = ListItem(List=sort_list.Keys, Index=0, Wrap=False)
dot_display = DotDisplay(Point=evaluate_length_68.Point, Colour=RGB(194, 194, 194), Size=expr("X/2", list_item_2))

expression_205 = Expression(O=sort_list.Keys, Expression="FORMAT(\"{0:R}\",O)")  # disabled
panel_300 = Panel(expression_205)

line_sdl_31 = LineSDL(Start=evaluate_length_68.Point, Direction=line_sdl_28, Length=expr("ABS(X)", multiplication_11))

evaluate_length_70 = EvaluateLength(Curve=line_sdl_31, Length=1, Normalized=True)  # -> Point, Tangent, Parameter
interpolate_13 = Interpolate(Vertices=evaluate_length_70.Point, Degree=1, Periodic=False, KnotStyle=2)  # -> Curve, Length, Domain
custom_preview_26 = CustomPreview(Geometry=interpolate_13.Curve, Material=create_material_38)
custom_preview_27 = CustomPreview(Geometry=line_sdl_31, Material=create_material_39)

line_sdl_32 = LineSDL(Start=evaluate_length_70.Point, Direction=line_sdl_28, Length=expr("ABS(X)", multiplication_23))  # disabled

evaluate_length_71 = EvaluateLength(Curve=line_sdl_32, Length=1, Normalized=True)  # -> Point, Tangent, Parameter
interpolate_14 = Interpolate(Vertices=evaluate_length_71.Point, Degree=1, Periodic=False, KnotStyle=2)  # -> Curve, Length, Domain
custom_preview_28 = CustomPreview(Geometry=interpolate_14.Curve, Material=create_material_36)
custom_preview_29 = CustomPreview(Geometry=line_sdl_32, Material=create_material_37)

line_sdl_33 = LineSDL(Start=evaluate_length_71.Point, Direction=line_sdl_28, Length=expr("ABS(X)", multiplication_13))  # disabled

evaluate_length_72 = EvaluateLength(Curve=line_sdl_33, Length=1, Normalized=True)  # -> Point, Tangent, Parameter
interpolate_15 = Interpolate(Vertices=evaluate_length_72.Point, Degree=1, Periodic=False, KnotStyle=2)  # -> Curve, Length, Domain
custom_preview_30 = CustomPreview(Geometry=interpolate_15.Curve, Material=create_material_34)
custom_preview_31 = CustomPreview(Geometry=line_sdl_33, Material=create_material_35)

line_sdl_34 = LineSDL(Start=evaluate_length_72.Point, Direction=line_sdl_28, Length=expr("ABS(X)", multiplication_21))  # disabled

evaluate_length_73 = EvaluateLength(Curve=line_sdl_34, Length=1, Normalized=True)  # -> Point, Tangent, Parameter
interpolate_16 = Interpolate(Vertices=evaluate_length_73.Point, Degree=1, Periodic=False, KnotStyle=2)  # -> Curve, Length, Domain
custom_preview_32 = CustomPreview(Geometry=interpolate_16.Curve, Material=create_material_32)
custom_preview_33 = CustomPreview(Geometry=line_sdl_34, Material=create_material_33)

line_sdl_35 = LineSDL(Start=evaluate_length_73.Point, Direction=line_sdl_28, Length=expr("ABS(X)", multiplication_15))

evaluate_length_74 = EvaluateLength(Curve=line_sdl_35, Length=1, Normalized=True)  # -> Point, Tangent, Parameter
interpolate_17 = Interpolate(Vertices=evaluate_length_74.Point, Degree=1, Periodic=False, KnotStyle=2)  # -> Curve, Length, Domain
custom_preview_34 = CustomPreview(Geometry=interpolate_17.Curve, Material=create_material_30)
custom_preview_35 = CustomPreview(Geometry=line_sdl_35, Material=create_material_31)

line_sdl_36 = LineSDL(Start=evaluate_length_74.Point, Direction=line_sdl_28, Length=expr("ABS(X)", multiplication_17))

evaluate_length_75 = EvaluateLength(Curve=line_sdl_36, Length=1, Normalized=True)  # -> Point, Tangent, Parameter
interpolate_18 = Interpolate(Vertices=evaluate_length_75.Point, Degree=1, Periodic=False, KnotStyle=2)  # -> Curve, Length, Domain
custom_preview_36 = CustomPreview(Geometry=interpolate_18.Curve, Material=create_material_28)
custom_preview_37 = CustomPreview(Geometry=line_sdl_36, Material=create_material_29)

line_sdl_37 = LineSDL(Start=evaluate_length_75.Point, Direction=line_sdl_28, Length=expr("ABS(X)", multiplication_19))  # disabled

evaluate_length_76 = EvaluateLength(Curve=line_sdl_37, Length=1, Normalized=True)  # -> Point, Tangent, Parameter
interpolate_19 = Interpolate(Vertices=evaluate_length_76.Point, Degree=1, Periodic=False, KnotStyle=2)  # -> Curve, Length, Domain
custom_preview_38 = CustomPreview(Geometry=interpolate_19.Curve, Material=create_material_26)
custom_preview_39 = CustomPreview(Geometry=line_sdl_37, Material=create_material_27)

length_3 = Length(Curve=line_sdl_28)
sort_list_2 = SortList(Keys=length_3, ValuesA=line_sdl_28)  # -> reverse(flatten(Keys)), reverse(flatten(ValuesA))
list_item_3 = ListItem(List=sort_list_2.Keys, Index=0, Wrap=False)
panel_301 = Panel(list_item_3)

length_4 = Length(Curve=line_sdl_31)
sort_list_3 = SortList(Keys=length_4, ValuesValuesA=line_sdl_31)  # -> reverse(flatten(Keys)), reverse(flatten(ValuesValuesA))
list_item_4 = ListItem(List=sort_list_3.Keys, Index=0, Wrap=False)
panel_302 = Panel(list_item_4)
division_29 = Division(A=list_item_3, B=list_item_4)
expression_206 = Expression(X=division_29, Expression="FORMAT(\"{0:R}\",X)")  # -> simplify(Result)
panel_303 = Panel(expression_206)

curve_148 = Curve(interpolate_13.Curve)  # disabled
curve_149 = Curve(interpolate_12.Curve)  # disabled
evaluate_length_77 = EvaluateLength(Curve=curve_149, Length=[0.0625, 0.1875, 0.3125, 0.4375, 0.5625, 0.6875, 0.8125, 0.9375], Normalized=True)  # -> Point, Tangent, Parameter; disabled
circle_tantan = CircleTanTan(CurveA=curve_149, CurveB=curve_148, Point=evaluate_length_77.Point)  # disabled

curve_150 = Curve(interpolate_12.Curve)  # disabled
curve_151 = Curve(interpolate_10.Curve)  # disabled
evaluate_length_78 = EvaluateLength(Curve=curve_151, Length=[0.125, 0.375, 0.625, 0.875], Normalized=True)  # -> Point, Tangent, Parameter; disabled
circle_tantan_2 = CircleTanTan(CurveA=curve_151, CurveB=curve_150, Point=evaluate_length_78.Point)  # disabled

curve_152 = Curve(curve_144)  # disabled
curve_153 = Curve(interpolate_10.Curve)  # disabled
evaluate_length_79 = EvaluateLength(Curve=curve_153, Length=[0.25, 0.75], Normalized=True)  # -> Point, Tangent, Parameter; disabled
circle_tantan_3 = CircleTanTan(CurveA=curve_153, CurveB=curve_152, Point=evaluate_length_79.Point)  # disabled
