# Grasshopper definition XHG...⠀ⵙ⠀ᗝ⠀ⵙ⠀ꖴ⠀ⵙ⠀Ⓞ⠀ⵙ⠀ᙏ⠀ⵙ⠀ᕤᕦ⠀ⵙ⠀ꖴ⠀ⵙ⠀ᔓᔕ⠀ⵙ⠀◯⠀ⵙ⠀ИN⠀ⵙ⠀Ⓞ⠀ⵙ⠀ꖴ⠀ⵙ⠀✤⠀ⵙ⠀ꖴ⠀ⵙ⠀ᔓᔕ⠀ⵙ⠀ИN⠀ⵙ⠀ᗩ⠀ⵙ⠀ᴥ⠀ⵙ⠀✤⠀ⵙ⠀◯⠀ⵙ⠀ᗱᗴ⠀ⵙ⠀ᕤᕦ⠀ⵙ⠀ᗝ⠀ⵙ⠀ᗱᗴ⠀ⵙ⠀◯⠀ⵙ⠀ᙁ⠀ⵙ⠀ᑎ⠀ⵙ⠀ꗳ⠀ⵙ⠀◯⠀ⵙ⠀◯⠀ⵙ⠀ꗳ⠀ⵙ⠀ᑎ⠀ⵙ⠀ᙁ⠀ⵙ⠀◯⠀ⵙ⠀ᗱᗴ⠀ⵙ⠀ᗝ⠀ⵙ⠀ᕤᕦ⠀ⵙ⠀ᗱᗴ⠀ⵙ⠀◯⠀ⵙ⠀✤⠀ⵙ⠀ᴥ⠀ⵙ⠀ᗩ⠀ⵙ⠀ИN⠀ⵙ⠀ᔓᔕ⠀ⵙ⠀ꖴ⠀ⵙ⠀✤⠀ⵙ⠀ꖴ⠀ⵙ⠀Ⓞ⠀ⵙ⠀ИN⠀ⵙ⠀◯⠀ⵙ⠀ᔓᔕ⠀ⵙ⠀ꖴ⠀ⵙ⠀ᕤᕦ⠀ⵙ⠀ᙏ⠀ⵙ⠀Ⓞ⠀ⵙ⠀ꖴ⠀ⵙ⠀ᗝ⠀ⵙ⠀...GHX (Grasshopper 1.0.7)
# plug-ins: Pufferfish, Heteroptera

digit_scroller = DigitScroller(Scroller_Digits=12, Scroller_Prefix=" ", Scroller_Radix=1, Scroller_Value=0.5)
line_sdl = LineSDL(Start=Point(0, 0, 0), Direction=Vector(-0.5, 0, 0), Length=1)
line_sdl_2 = LineSDL(Start=Point(1, 1, 0), Direction=Vector(1, 0, 0), Length=1)
flip_curve = FlipCurve(Curve=line_sdl)  # -> Curve, Flag
blend_curve = BlendCurve(CurveA=flip_curve.Curve, CurveB=line_sdl_2, BulgeA=digit_scroller, BulgeB=digit_scroller, Continuity=2)
flip_curve_2 = FlipCurve(Curve=line_sdl_2)  # -> Curve, Flag

point = Point(Point(0.5, 0.5, 0))  # disabled
xy_plane = XYPlane(Origin=point)  # disabled
point_2 = Point(Point(0, 0, 0))  # disabled
point_3 = Point(Point(0.25, 0, 0))  # disabled
point_4 = Point(Point(0.3947752686, 0.1978476179, 0))  # disabled
merge = Merge(Data1=point_2, Data2=point_3, Data3=point_4)  # disabled
rotate = Rotate(Geometry=merge, Angle=3.141592654, Plane=point)  # -> reverse(Geometry), Transform; disabled
mirror = Mirror(Geometry=rotate.Geometry, Plane=xy_plane)  # -> Geometry, Transform; disabled
merge_2 = Merge(Data1=merge, Data2=point, Data3=mirror.Geometry)  # disabled
nurbs_curve = NurbsCurve(Vertices=merge_2, Degree=11, Periodic=False)  # -> Curve, Length, Domain; disabled
interpolate = Interpolate(Vertices=merge_2, Degree=3, Periodic=False, KnotStyle=1)  # -> Curve, Length, Domain; disabled
point_5 = Point(Point(0.2006577215, 0, 0))  # disabled
point_6 = Point(Point(0.2830260225, 0.08609833668, 0))  # disabled
point_7 = Point(Point(0.3323482284, 0.16322326, 0))  # disabled

curve = Curve(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)

panel = Panel("0.0000710748925500000001421")
panel_2 = Panel("0.0013733120705119695")

digit_scroller_2 = DigitScroller(Scroller_Digits=12, Scroller_Prefix=" ", Scroller_Radix=1, Scroller_Value=0.09572649568)

digit_scroller_3 = DigitScroller(Scroller_Digits=12, Scroller_Prefix="Digit Scroller", Scroller_Radix=5, Scroller_Value=151.7037036)

curve_2 = Curve(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)
panel_3 = Panel("0.00137956207")
panel_4 = Panel("""0.00032220000
0.00000220000""")
digit_scroller_4 = DigitScroller(Scroller_Digits=12, Scroller_Prefix="Digit Scroller", Scroller_Radix=1, Scroller_Value=7.7777e-05)
curve_3 = Curve(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)
digit_scroller_5 = DigitScroller(Scroller_Digits=12, Scroller_Prefix="Digit Scroller", Scroller_Radix=1, Scroller_Value=4.7e-05)
curve_4 = Curve(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)
panel_5 = Panel("0.001373312092932693349")
curve_5 = Curve(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)

digit_scroller_6 = DigitScroller(Scroller_Digits=12, Scroller_Prefix="Digit Scroller", Scroller_Radix=1, Scroller_Value=8.58112e-05)
panel_7 = Panel(digit_scroller_6)

panel_8 = Panel(panel_7)
panel_9 = Panel(panel_7)
panel_10 = Panel(panel_7)
curve_6 = Curve(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)
xz_plane = XZPlane(Origin=Point(0, 0, 0))
point_8 = Point(Point(0, 1, 0))
arc = Arc(Plane=point_8, Radius=1, Angle=Domain(-1.570796327, 0))  # -> Arc, Length
xz_plane_2 = XZPlane(Origin=point_8)
evaluate_length = EvaluateLength(Curve=arc.Arc, Length=1, Normalized=True)  # -> Point, Tangent, Parameter
yz_plane = YZPlane(Origin=Point(0, 0, 0))
yz_plane_2 = YZPlane(Origin=Point(0, 0, 0))
line = Line(Line((0, 0, 0), (-1, 1, 0)))
number_slider = Slider(0, range=0..32)
curve_from_2_views = CurveFrom2Views(
    PointA=curve_from_2_views.PointOnCurve,
    PointB=curve_from_2_views.PointOnCurve,
    PointC=curve_from_2_views.PointOnCurve,
    PointOnCurve=curve_from_2_views.Curve,
    Curve_5=curve_from_2_views.Curve,
    PointA_2=curve_from_2_views.PointOnCurve,
    PointB_2=curve_from_2_views.PointOnCurve,
    PointC_2=curve_from_2_views.PointOnCurve,
    PointOnCurve_2=curve_from_2_views.Curve,
    Curve_6=curve_from_2_views.Curve,
    Curve_7=curve_from_2_views.Curve,
    Brep=curve_from_2_views.Geometry,
    Direction=curve_from_2_views.Plane,
    Base=curve_from_2_views.Curve,
    Direction_2=curve_from_2_views.Vector,
    Vector=curve_from_2_views.Plane,
    PointOnCurve_3=curve_from_2_views.Curve,
    PointOnCurve_4=curve_from_2_views.Curve,
    PointOnCurve_5=curve_from_2_views.Curve,
    PointOnCurve_6=curve_from_2_views.Curve,
    Box=curve_from_2_views.Box,
    Content=curve_from_2_views.Curve,
    Union=False,
    Plane=PlaneXY(0, 0, 0),
    Domain=curve_from_2_views.X,
    Domain_2=curve_from_2_views.Y,
    Domain_3=curve_from_2_views.Z,
    StreamA=[curve_from_2_views.Start, curve_from_2_views.End],
    StreamB=[curve_from_2_views.Start, curve_from_2_views.End],
    StreamC=[curve_from_2_views.Start, curve_from_2_views.End],
    Keys=curve_from_2_views.Stream,
    Numbers=curve_from_2_views.List,
    Vector_2=curve_from_2_views.Vector,
    Amplitude=curve_from_2_views.Domain,
    Geometry=curve_from_2_views.Extrusion,
    Translation=curve_from_2_views.Result,
    Vector_3=curve_from_2_views.Vector,
    A=curve_from_2_views.Vector,
    B=2,
    Curve_8=curve_from_2_views.Curve,
    Anchor=curve_from_2_views.PointOnCurve,
    Vector_4=curve_from_2_views.Result,
    Anchor_2=curve_from_2_views.PointOnCurve,
    Vector_5=curve_from_2_views.Result,
    Vector_6=curve_from_2_views.Plane,
    Amplitude_2=curve_from_2_views.Domain,
    A_2=curve_from_2_views.Vector,
    B_2=2,
    Curve_9=curve_from_2_views.Curve,
    Curve_10=curve_from_2_views.Curve,
    AuthorContact="and3dm@gmail.com",
    InternalDocument_plugin_version=(1, 0, 7),
    InternalDocument_DocumentHeader_PreviewMeshType=1,
    InternalDocument_DocumentHeader_PreviewNormal=RGBA(150, 0, 0, 100),
    InternalDocument_DocumentHeader_PreviewSelected=RGBA(0, 150, 0, 100),
    InternalDocument_DefinitionProperties_Projection_Zoom=0.640000045)  # -> Curve, Curve_2
number_slider_2 = Slider(20.424688, range=0..32)
number = Number([1, 2, 4, 7, 11, 7, 4, 2, 1])
panel_12 = Panel(number)

relative_differences = RelativeDifferences(Values=number)
panel_13 = Panel(relative_differences)
list_length = ListLength(List=relative_differences)
series = Series(Start=1, Step=1, Count=expr("X-1", list_length))
list_item = ListItem(List=relative_differences, Index=series, Wrap=False)
panel_14 = Panel(list_item)

relative_differences_2 = RelativeDifferences(Values=list_item)
panel_15 = Panel(relative_differences_2)
list_length_2 = ListLength(List=relative_differences_2)
series_2 = Series(Start=1, Step=1, Count=expr("X-1", list_length_2))
list_item_2 = ListItem(List=relative_differences_2, Index=series_2, Wrap=False)
panel_16 = Panel(list_item_2)

number_slider_3 = Slider(13.114764, range=0..256)  # disabled
line_sdl_3 = LineSDL(Start=Point(0, 0, 0), Direction=Vector(1, 0, 0), Length=1)  # disabled

number_2 = Number(1024)  # disabled

divide_curve = DivideCurve(Curve=line_sdl_3, Count=number_2, Kinks=False)  # -> Points, Tangents, Parameters; disabled

digit_scroller_7 = DigitScroller(Scroller_Digits=12, Scroller_Prefix=" ", Scroller_Radix=11, Scroller_Value=256)  # disabled
digit_scroller_8 = DigitScroller(Scroller_Digits=12, Scroller_Prefix=" ", Scroller_Radix=11, Scroller_Value=90)  # disabled
create_material = CreateMaterial(Diffuse=RGB(222, 222, 222), Specular=RGB(0, 255, 255), Emission=RGB(0, 0, 0), Transparency=0.5, Shine=100)  # disabled
create_material_2 = CreateMaterial(Diffuse=RGB(247, 247, 247), Specular=RGB(0, 255, 255), Emission=RGB(0, 0, 0), Transparency=0.5, Shine=100)  # disabled
create_material_3 = CreateMaterial(Diffuse=RGB(176, 176, 176), Specular=RGB(0, 255, 255), Emission=RGB(0, 0, 0), Transparency=0.5, Shine=100)  # disabled
number_3 = Number(digit_scroller_7)  # disabled
number_4 = Number(number_3)  # disabled

number_slider_4 = Slider(0.452284, range=0..1)  # disabled

number_slider_5 = Slider(0.0625, range=0..2)  # disabled

create_material_4 = CreateMaterial(Diffuse=RGB(207, 207, 207), Specular=RGB(0, 255, 255), Emission=RGB(0, 0, 0), Transparency=0.5, Shine=100)  # disabled
create_material_5 = CreateMaterial(Diffuse=RGB(232, 232, 232), Specular=RGB(0, 255, 255), Emission=RGB(0, 0, 0), Transparency=0.5, Shine=100)  # disabled
create_material_6 = CreateMaterial(Diffuse=RGB(214, 214, 214), Specular=RGB(0, 255, 255), Emission=RGB(0, 0, 0), Transparency=0.5, Shine=100)  # disabled
create_material_7 = CreateMaterial(Diffuse=RGB(240, 240, 240), Specular=RGB(0, 255, 255), Emission=RGB(0, 0, 0), Transparency=0.5, Shine=100)  # disabled

panel_17 = Panel("0.0000053644183496292")  # disabled
panel_18 = Panel("""0    256    0.0013733120705119695
0    4096    0.0000053644183496292""")  # disabled

digit_scroller_9 = DigitScroller(Scroller_Digits=12, Scroller_Prefix="Digit Scroller", Scroller_Radix=1, Scroller_Value=3.3527e-07)  # disabled
number_slider_6 = Slider(4096, range=0..65536)  # disabled
radians = Radians(Degrees=panel_17)  # disabled

number_5 = Number(number_slider_6)  # disabled

series_3 = Series(Start=0, Step=radians, Count=number_5)  # disabled
one_over_x = OneOverX(Value=number_5)  # disabled
duplicate_data = DuplicateData(Data=one_over_x, Number=number_5, Order=True)  # disabled
turtle = DotNETVBScriptLEGACY(Forward=duplicate_data, Left=series_3)  # -> Output, Points; inputs Forward: list, Left: list; disabled
# ---------- turtle: VB ----------
    Dim i As Integer
    Dim dir As New On3dVector(1, 0, 0)    
    Dim pos As New On3dVector(0, 0, 0) 
    Dim axis As New On3dVector(0, 0, 1)
    Dim pnts As New List(Of On3dVector)

    pnts.Add(pos)
    
    For i = 0 To Forward.Count() - 1
      Dim P As New On3dVector
      dir.Rotate(Left(i), axis)      
      P = dir * Forward(i) + pnts(i)
      pnts.Add(P)
    Next
    
    Points = pnts
# ---------- end turtle ----------
point_9 = Point(turtle.Points)  # disabled

interpolate_t = InterpolateT(Vertices=point_9, TangentStart=Vector(0.0625, 0, 0), TangentEnd=Vector(0, 0, 0), KnotStyle=2)  # -> Curve, Length, Domain; disabled
evaluate_length_2 = EvaluateLength(Curve=interpolate_t.Curve, Length=1, Normalized=True)  # -> Point, Tangent, Parameter; disabled
line_sdl_4 = LineSDL(Start=evaluate_length_2.Point, Direction=evaluate_length_2.Tangent, Length=1)  # disabled
mirror_2 = Mirror(Geometry=interpolate_t.Curve, Plane=line_sdl_4)  # -> Geometry, Transform; disabled
join_curves = JoinCurves(Curves=[interpolate_t.Curve, mirror_2.Geometry], Preserve=False)  # disabled
evaluate_length_3 = EvaluateLength(Curve=join_curves, Length=1, Normalized=True)  # -> Point, Tangent, Parameter; disabled
rotate_2 = Rotate(Geometry=join_curves, Angle=3.141592654, Plane=evaluate_length_3.Point)  # -> Geometry, Transform; disabled
join_curves_2 = JoinCurves(Curves=[join_curves, rotate_2.Geometry], Preserve=False)  # disabled
curve_7 = Curve(join_curves_2)  # disabled

expression = Expression(O=turtle.Points, Expression="FORMAT(\"{0:R}\",O)")  # disabled
panel_19 = Panel(expression)  # disabled
expression_2 = Expression(O=series_3, Expression="FORMAT(\"{0:R}\",O)")  # disabled
panel_20 = Panel(expression_2)  # disabled
evaluate_length_4 = EvaluateLength(Curve=join_curves_2, Length=1, Normalized=True)  # -> Point, Tangent, Parameter; disabled
deconstruct = Deconstruct(Point=evaluate_length_4.Point)  # -> XComponent, YComponent, ZComponent; disabled
expression_3 = Expression(O=deconstruct.YComponent, Expression="FORMAT(\"{0:R}\",O)")  # disabled
expression_4 = Expression(O=deconstruct.XComponent, Expression="FORMAT(\"{0:R}\",O)")  # disabled
expression_5 = Expression(O=deconstruct.ZComponent, Expression="FORMAT(\"{0:R}\",O)")  # disabled
panel_21 = Panel(expression_3)  # disabled
panel_22 = Panel(expression_4)  # disabled
panel_23 = Panel(expression_5)  # disabled
addition = Addition(A=panel_21, B=panel_22)  # disabled
expression_6 = Expression(O=addition, Expression="FORMAT(\"{0:R}\",O)")  # disabled
panel_24 = Panel(expression_6)  # disabled
division = Division(A=panel_24, B=2)  # disabled
expression_7 = Expression(O=division, Expression="FORMAT(\"{0:R}\",O)")  # disabled
panel_25 = Panel(expression_7)  # disabled
scale = Scale(Geometry=curve_7, Center=Point(0, 0, 0), Factor=expr("1/X", panel_25))  # -> Geometry, Transform; disabled
evaluate_length_5 = EvaluateLength(Curve=scale.Geometry, Length=1, Normalized=True)  # -> Point, Tangent, Parameter; disabled
deconstruct_2 = Deconstruct(Point=evaluate_length_5.Point)  # -> XComponent, YComponent, ZComponent; disabled
expression_8 = Expression(O=deconstruct_2.YComponent, Expression="FORMAT(\"{0:R}\",O)")  # disabled
expression_9 = Expression(O=deconstruct_2.XComponent, Expression="FORMAT(\"{0:R}\",O)")  # disabled
expression_10 = Expression(O=deconstruct_2.ZComponent, Expression="FORMAT(\"{0:R}\",O)")  # disabled
panel_26 = Panel(expression_8)  # disabled
panel_27 = Panel(expression_9)  # disabled
panel_28 = Panel(expression_10)  # disabled
division_2 = Division(A=panel_22, B=panel_21)  # disabled
expression_11 = Expression(O=division_2, Expression="FORMAT(\"{0:R}\",O)")  # disabled
panel_29 = Panel(expression_11)  # disabled
curve_8 = Curve(scale.Geometry)  # disabled

digit_scroller_10 = DigitScroller(Scroller_Digits=12, Scroller_Prefix="Digit Scroller", Scroller_Radix=11, Scroller_Value=65536)  # disabled
construct_point = ConstructPoint(XCoordinate=0.5, YCoordinate=0.5, ZCoordinate=0)  # -> flatten(Point); disabled
line_sdl_5 = LineSDL(Start=Point(0, 0, 0), Direction=Vector(1, 0, 0), Length=expr("X/2", 1))  # disabled
button = Button()  # disabled
number_6 = Number(expr("X*4", number_5))  # disabled
divide_curve_2 = DivideCurve(Curve=line_sdl_5, Count=expr("X/2", number_6), Kinks=False)  # -> Points, Tangents, Parameters; disabled
line_sdl_6 = LineSDL(Start=divide_curve_2.Points, Direction=Vector(0, 1, 0), Length=1)  # disabled
number_7 = Number(digit_scroller_10)  # disabled
scale_2 = Scale(Geometry=line_sdl_6, Center=Point(0, 0, 0), Factor=number_7)  # -> Geometry, Transform; disabled
curve_9 = Curve(curve_8)  # disabled
scale_3 = Scale(Geometry=curve_9, Center=Point(0, 0, 0), Factor=number_7)  # -> Geometry, Transform; disabled
curve_curve = CurveCurve(CurveA=scale_3.Geometry, CurveB=scale_2.Geometry)  # -> flatten(Points), ParamsA, ParamsB; disabled
scale_4 = Scale(Geometry=curve_curve.Points, Center=Point(0, 0, 0), Factor=expr("1/X", number_7))  # -> Geometry, Transform; disabled
deconstruct_3 = Deconstruct(Point=scale_4.Geometry)  # -> expr("ABS(X)", graft(XComponent)), expr("ABS(X)", graft(YComponent)), expr("ABS(X)", graft(ZComponent)); disabled
construct_point_2 = ConstructPoint(XCoordinate=deconstruct_3.XComponent, YCoordinate=deconstruct_3.YComponent, ZCoordinate=deconstruct_3.ZComponent)  # disabled
list_length_3 = ListLength(List=scale_4.Geometry)  # disabled
panel_31 = Panel(list_length_3)  # disabled
construct_domain = ConstructDomain(DomainStart=0, DomainEnd=expr("X-2", panel_31))  # disabled
range = Range(Domain=construct_domain, Steps=expr("X-2", panel_31))  # disabled
list_item_3 = ListItem(List=flatten(construct_point_2), Index=range, Wrap=False)  # -> flatten(Item); disabled
rotate_3 = Rotate(Geometry=list_item_3, Angle=3.141592654, Plane=construct_point)  # -> reverse(flatten(Geometry)), Transform; disabled
merge_3 = Merge(Data1=list_item_3, Data2=construct_point, Data3=rotate_3.Geometry)  # disabled
deconstruct_4 = Deconstruct(Point=merge_3)  # -> graft(XComponent), graft(YComponent), ZComponent; disabled
expression_12 = Expression(O=deconstruct_4.XComponent, Expression="FORMAT(\"{0:0.00000000000000}\",O)")  # disabled
expression_13 = Expression(O=deconstruct_4.XComponent, Expression="FORMAT(\"{0:R}\",O)")  # disabled
data = Data(expression_13)  # disabled
panel_32 = Panel(data)  # disabled
file_path = FilePath("C:\IICSA.O____48361_EDIWID_1_TNEMERCNI____TNEIDARG_PUKOOL_ROLOC_DIOMGIS_ERUTAWRUC_RAENIL_NOITISNART_EGDE_LUF_EKUN____O____NUKE_FUL_EDGE_TRANSITION_LINEAR_CURWATURE_SIGMOID_COLOR_LOOKUP_GRADIENT____INCREMENT_1_DIWIDE_16384____O.ASCII")  # disabled
expression_14 = Expression(O=deconstruct_4.YComponent, Expression="FORMAT(\"{0:0.00000000000000}\",O)")  # disabled
expression_15 = Expression(O=deconstruct_4.YComponent, Expression="FORMAT(\"{0:R}\",O)")  # disabled
data_2 = Data(expression_15)  # disabled
panel_33 = Panel(data_2)  # disabled
txtwriter = VBScript(filePath=file_path, data=flatten(panel_33), activate=button)  # -> out, A; inputs data: list; disabled
# ---------- txtwriter: VB ----------
    If activate Then

      Dim i As Integer
      Dim aryText(4) As String

      aryText(0) = "Mary WriteLine"
      aryText(1) = "Had"
      aryText(2) = "Another"
      aryText(3) = "Little"
      aryText(4) = "One"

      ' the data is appended to the file. If file doesnt exist, a new file is created
      Dim objWriter As New System.IO.StreamWriter(filePath, append)

      For i = 0 To data.Count - 1
        objWriter.WriteLine(data(i))
      Next

      objWriter.Close()

    End If

    If clearFile Then
      Dim objWriter As New System.IO.StreamWriter(filePath, False)
      objWriter.Close()
    End If
# ---------- end txtwriter ----------

number_slider_7 = Slider(0, range=0..1)  # disabled
button_2 = Button()  # disabled
number_8 = Number(expr("X*4", number_5))  # disabled
file_path_2 = FilePath("C:\VSC.O____EPAHS_LANGIS____STNEMGES_48361____DIOMGIS_ERUTAWRUC_RAENIL_NOITISNART_EGDE_LUF____O____FUL_EDGE_TRANSITION_LINEAR_CURWATURE_SIGMOID____16384_SEGMENTS____SIGNAL_SHAPE____O.CSV")  # disabled
curve_10 = Curve(curve_8)  # disabled
evaluate_length_6 = EvaluateLength(Curve=curve_10, Length=flatten(1), Normalized=True)  # -> Point, Tangent, Parameter; disabled
yz_plane_3 = YZPlane(Origin=evaluate_length_6.Point)  # disabled
mirror_3 = Mirror(Geometry=curve_10, Plane=yz_plane_3)  # -> Geometry, Transform; disabled
join_curves_3 = JoinCurves(Curves=[curve_10, mirror_3.Geometry], Preserve=False)  # disabled
linear_array = LinearArray(Geometry=join_curves_3, Direction=Vector(2, 0, 0), Count=2)  # -> Geometry, Transform; disabled
join_curves_4 = JoinCurves(Curves=linear_array.Geometry, Preserve=False)  # disabled
flip_curve_3 = FlipCurve(Curve=join_curves_4)  # -> Curve, Flag; disabled
stream_filter = StreamFilter(Gate=number_slider_7, Stream0=join_curves_4, Stream1=flip_curve_3.Curve)  # disabled
curve_domain = CurveDomain(Curve=stream_filter)  # -> Curve, Domain; disabled
deconstruct_domain = DeconstructDomain(Domain=curve_domain.Domain)  # -> Start, End; disabled
construct_domain_2 = ConstructDomain(DomainStart=expr("X/8", deconstruct_domain.End), DomainEnd=expr("X*5/8", deconstruct_domain.End))  # disabled
sub_curve = SubCurve(BaseCurve=curve_domain.Curve, Domain=construct_domain_2)  # disabled
move = Move(Geometry=sub_curve, Motion=Vector(-0.5, -0.5, 0))  # -> Geometry, Transform; disabled
scale_5 = Scale(Geometry=move.Geometry, Center=Point(0, 0, 0), Factor=0.5)  # -> Geometry, Transform; disabled
divide_curve_3 = DivideCurve(Curve=scale_5.Geometry, Count=number_8, Kinks=False)  # -> Points, Tangents, Parameters; disabled
deconstruct_5 = Deconstruct(Point=divide_curve_3.Points)  # -> simplify(graft(XComponent)), simplify(graft(YComponent)), ZComponent; disabled
expression_16 = Expression(X=deconstruct_5.XComponent, Expression="FORMAT(\"{0:R}\",X)")  # disabled
panel_34 = Panel(expression_16)  # disabled
expression_17 = Expression(Y=deconstruct_5.YComponent, Expression="FORMAT(\"{0:R}\",Y)")  # disabled
list_length_4 = ListLength(List=divide_curve_3.Points)  # disabled
duplicate_data_2 = DuplicateData(Data=";", Number=list_length_4, Order=True)  # -> simplify(graft(Data)); disabled
panel_35 = Panel(duplicate_data_2)  # disabled
panel_36 = Panel(expression_17)  # disabled
concatenate = Concatenate(FragmentA=panel_34, FragmentB=panel_35, FragmentA_2=panel_36)  # -> flatten(Result); disabled
panel_37 = Panel(concatenate)  # disabled
txtwriter_2 = VBScript(filePath=file_path_2, data=flatten(panel_37), activate=button_2)  # -> out, A; inputs data: list; disabled; same code as txtwriter

digit_scroller_11 = DigitScroller(Scroller_Digits=12, Scroller_Prefix="Digit Scroller", Scroller_Radix=5, Scroller_Value=20817.02838)

digit_scroller_12 = DigitScroller(Scroller_Digits=12, Scroller_Prefix="Digit Scroller", Scroller_Radix=4, Scroller_Value=2233.523438)

digit_scroller_13 = DigitScroller(Scroller_Digits=12, Scroller_Prefix="Digit Scroller", Scroller_Radix=4, Scroller_Value=281.0810667)
line_sdl_7 = LineSDL(Start=Point(-2.121093912, 1.99985794, 0), Direction=Vector(0.0625, 0.0625, 0), Length=1)

digit_scroller_14 = DigitScroller(Scroller_Digits=12, Scroller_Prefix="Digit Scroller", Scroller_Radix=3, Scroller_Value=4.392015)

digit_scroller_15 = DigitScroller(Scroller_Digits=12, Scroller_Prefix="Digit Scroller", Scroller_Radix=3, Scroller_Value=0.0689)
line_sdl_8 = LineSDL(Start=Point(0, 0, 0), Direction=Vector(1, 0, 0), Length=1)

digit_scroller_16 = DigitScroller(Scroller_Digits=12, Scroller_Prefix="Digit Scroller", Scroller_Radix=5, Scroller_Value=56336.19681)

digit_scroller_17 = DigitScroller(Scroller_Digits=12, Scroller_Prefix="Digit Scroller", Scroller_Radix=6, Scroller_Value=271915.0063)

digit_scroller_18 = DigitScroller(Scroller_Digits=12, Scroller_Prefix="Digit Scroller", Scroller_Radix=6, Scroller_Value=383463.9766)

digit_scroller_19 = DigitScroller(Scroller_Digits=12, Scroller_Prefix="Digit Scroller", Scroller_Radix=7, Scroller_Value=2183007.899)

create_material_8 = CreateMaterial(Diffuse=RGB(191, 191, 191), Specular=RGB(0, 255, 255), Emission=RGB(0, 0, 0), Transparency=0.5, Shine=100)

create_material_9 = CreateMaterial(Diffuse=RGB(217, 217, 217), Specular=RGB(0, 255, 255), Emission=RGB(0, 0, 0), Transparency=0.5, Shine=100)

create_material_10 = CreateMaterial(Diffuse=RGB(199, 199, 199), Specular=RGB(0, 255, 255), Emission=RGB(0, 0, 0), Transparency=0.5, Shine=100)

create_material_11 = CreateMaterial(Diffuse=RGB(224, 224, 224), Specular=RGB(0, 255, 255), Emission=RGB(0, 0, 0), Transparency=0.5, Shine=100)

create_material_12 = CreateMaterial(Diffuse=RGB(207, 207, 207), Specular=RGB(0, 255, 255), Emission=RGB(0, 0, 0), Transparency=0.5, Shine=100)

create_material_13 = CreateMaterial(Diffuse=RGB(232, 232, 232), Specular=RGB(0, 255, 255), Emission=RGB(0, 0, 0), Transparency=0.5, Shine=100)

create_material_14 = CreateMaterial(Diffuse=RGB(214, 214, 214), Specular=RGB(0, 255, 255), Emission=RGB(0, 0, 0), Transparency=0.5, Shine=100)

create_material_15 = CreateMaterial(Diffuse=RGB(240, 240, 240), Specular=RGB(0, 255, 255), Emission=RGB(0, 0, 0), Transparency=0.5, Shine=100)

create_material_16 = CreateMaterial(Diffuse=RGB(222, 222, 222), Specular=RGB(0, 255, 255), Emission=RGB(0, 0, 0), Transparency=0.5, Shine=100)

create_material_17 = CreateMaterial(Diffuse=RGB(247, 247, 247), Specular=RGB(0, 255, 255), Emission=RGB(0, 0, 0), Transparency=0.5, Shine=100)

create_material_18 = CreateMaterial(Diffuse=RGB(176, 176, 176), Specular=RGB(0, 255, 255), Emission=RGB(0, 0, 0), Transparency=0.5, Shine=100)

create_material_19 = CreateMaterial(Diffuse=RGB(201, 201, 201), Specular=RGB(0, 255, 255), Emission=RGB(0, 0, 0), Transparency=0.5, Shine=100)

create_material_20 = CreateMaterial(Diffuse=RGB(184, 184, 184), Specular=RGB(0, 255, 255), Emission=RGB(0, 0, 0), Transparency=0.5, Shine=100)

create_material_21 = CreateMaterial(Diffuse=RGB(209, 209, 209), Specular=RGB(0, 255, 255), Emission=RGB(0, 0, 0), Transparency=0.5, Shine=100)

create_material_22 = CreateMaterial(Diffuse=RGB(168, 168, 168), Specular=RGB(0, 255, 255), Emission=RGB(0, 0, 0), Transparency=0.5, Shine=100)

create_material_23 = CreateMaterial(Diffuse=RGB(194, 194, 194), Specular=RGB(0, 255, 255), Emission=RGB(0, 0, 0), Transparency=0.5, Shine=100)

create_material_24 = CreateMaterial(Diffuse=RGB(161, 161, 161), Specular=RGB(0, 255, 255), Emission=RGB(0, 0, 0), Transparency=0.5, Shine=100)

create_material_25 = CreateMaterial(Diffuse=RGB(186, 186, 186), Specular=RGB(0, 255, 255), Emission=RGB(0, 0, 0), Transparency=0.5, Shine=100)

panel_38 = Panel("""0    256    0.0013733120705119695
0    4096    0.0000053644183496292""")
panel_39 = Panel("0.0013733120705119695*4*4")

digit_scroller_20 = DigitScroller(Scroller_Digits=12, Scroller_Prefix="Digit Scroller", Scroller_Radix=1, Scroller_Value=7.49e-08)
radians_2 = Radians(Degrees=panel_8)

number_9 = Number(Slider(256, range=0..65536))

series_4 = Series(Start=0, Step=radians_2, Count=number_9)
one_over_x_2 = OneOverX(Value=number_9)
duplicate_data_3 = DuplicateData(Data=one_over_x_2, Number=number_9, Order=True)
turtle_2 = DotNETVBScriptLEGACY(Forward=duplicate_data_3, Left=series_4)  # -> Output, Points; inputs Forward: list, Left: list; same code as turtle
point_10 = Point(turtle_2.Points)

interpolate_t_2 = InterpolateT(Vertices=point_10, TangentStart=Vector(0.0625, 0, 0), TangentEnd=Vector(0, 0, 0), KnotStyle=2)  # -> Curve, Length, Domain
evaluate_length_7 = EvaluateLength(Curve=interpolate_t_2.Curve, Length=1, Normalized=True)  # -> Point, Tangent, Parameter
line_sdl_9 = LineSDL(Start=evaluate_length_7.Point, Direction=evaluate_length_7.Tangent, Length=1)
mirror_4 = Mirror(Geometry=interpolate_t_2.Curve, Plane=line_sdl_9)  # -> Geometry, Transform
join_curves_5 = JoinCurves(Curves=[interpolate_t_2.Curve, mirror_4.Geometry], Preserve=False)
evaluate_length_8 = EvaluateLength(Curve=join_curves_5, Length=1, Normalized=True)  # -> Point, Tangent, Parameter
rotate_4 = Rotate(Geometry=join_curves_5, Angle=3.141592654, Plane=evaluate_length_8.Point)  # -> Geometry, Transform
join_curves_6 = JoinCurves(Curves=[join_curves_5, rotate_4.Geometry], Preserve=False)
curve_11 = Curve(join_curves_6)

expression_18 = Expression(O=turtle_2.Points, Expression="FORMAT(\"{0:R}\",O)")
panel_40 = Panel(expression_18)
expression_19 = Expression(O=series_4, Expression="FORMAT(\"{0:R}\",O)")
panel_41 = Panel(expression_19)
evaluate_length_9 = EvaluateLength(Curve=join_curves_6, Length=1, Normalized=True)  # -> Point, Tangent, Parameter
deconstruct_6 = Deconstruct(Point=evaluate_length_9.Point)  # -> XComponent, YComponent, ZComponent
expression_20 = Expression(O=deconstruct_6.YComponent, Expression="FORMAT(\"{0:R}\",O)")
expression_21 = Expression(O=deconstruct_6.XComponent, Expression="FORMAT(\"{0:R}\",O)")
expression_22 = Expression(O=deconstruct_6.ZComponent, Expression="FORMAT(\"{0:R}\",O)")
panel_42 = Panel(expression_20)
panel_43 = Panel(expression_21)
panel_44 = Panel(expression_22)
addition_2 = Addition(A=panel_42, B=panel_43)
expression_23 = Expression(O=addition_2, Expression="FORMAT(\"{0:R}\",O)")
panel_45 = Panel(expression_23)
division_3 = Division(A=panel_45, B=2)
expression_24 = Expression(O=division_3, Expression="FORMAT(\"{0:R}\",O)")
panel_46 = Panel(expression_24)
scale_6 = Scale(Geometry=curve_11, Center=Point(0, 0, 0), Factor=expr("1/X", panel_46))  # -> Geometry, Transform
evaluate_length_10 = EvaluateLength(Curve=scale_6.Geometry, Length=1, Normalized=True)  # -> Point, Tangent, Parameter
deconstruct_7 = Deconstruct(Point=evaluate_length_10.Point)  # -> XComponent, YComponent, ZComponent
expression_25 = Expression(O=deconstruct_7.YComponent, Expression="FORMAT(\"{0:R}\",O)")
expression_26 = Expression(O=deconstruct_7.XComponent, Expression="FORMAT(\"{0:R}\",O)")
expression_27 = Expression(O=deconstruct_7.ZComponent, Expression="FORMAT(\"{0:R}\",O)")
panel_47 = Panel(expression_25)
panel_48 = Panel(expression_26)
panel_49 = Panel(expression_27)
division_4 = Division(A=panel_43, B=panel_42)
expression_28 = Expression(O=division_4, Expression="FORMAT(\"{0:R}\",O)")
panel_50 = Panel(expression_28)
curve_12 = Curve(scale_6.Geometry)

number_10 = Number(expr("X*4", number_9))

curve_13 = Curve(curve_12)
end_points = EndPoints(Curve=curve_13)  # -> Start, End
rectangle_2pt = Rectangle2Pt(Plane=PlaneXY(0, 0, 0), PointA=end_points.Start, PointB=end_points.End, Radius=0)  # -> Rectangle, Length
deconstuct_rectangle = DeconstuctRectangle(Rectangle=rectangle_2pt.Rectangle)  # -> BasePlane, XInterval, YInterval
deconstruct_domain_2 = DeconstructDomain(Domain=deconstuct_rectangle.YInterval)  # -> Start, End
deconstruct_domain_3 = DeconstructDomain(Domain=deconstuct_rectangle.XInterval)  # -> Start, End
scale_nu = ScaleNU(
    Geometry=curve_12,
    Plane=PlaneXY(0, 0, 0),
    ScaleX=expr("1/X", deconstruct_domain_3.End),
    ScaleY=expr("1/X", deconstruct_domain_2.End),
    ScaleZ=1)  # -> Geometry, Transform
curve_14 = Curve(scale_nu.Geometry)

digit_scroller_21 = DigitScroller(Scroller_Digits=12, Scroller_Prefix=" ", Scroller_Radix=2, Scroller_Value=30.9312132)
curve_15 = Curve(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)
curve_16 = Curve(curve_12)
scale_7 = Scale(Geometry=curve_16, Center=Point(0, 0, 0), Factor=expr("2^X", "16.93121320041889709"))  # -> Geometry, Transform
curve_17 = Curve(scale_7.Geometry)

curve_18 = Curve(graft(curve_12))  # disabled
divide_curve_4 = DivideCurve(Curve=curve_18, Count=number_2, Kinks=False)  # -> Points, Tangents, Parameters; disabled
curvature = Curvature(Curve=curve_18, Parameter=divide_curve_4.Parameters)  # -> Point, Curvature, Curvature_2; disabled
deconstruct_arc = DeconstructArc(Arc=curvature.Curvature_2)  # -> BasePlane, Radius, Angle; disabled
expression_29 = Expression(O=deconstruct_arc.Radius, Expression="FORMAT(\"{0:R}\",O)")  # disabled
panel_52 = Panel(expression_29)  # disabled
one_over_x_3 = OneOverX(Value=deconstruct_arc.Radius)  # disabled

expression_30 = Expression(O=one_over_x_3, Expression="FORMAT(\"{0:R}\",O)")  # disabled
panel_53 = Panel(expression_30)  # disabled

quick_graph = QuickGraph(one_over_x_3, SortOrder=0)  # disabled
multiplication = Multiplication(A=one_over_x_3, B=number_slider_3)  # disabled
line_sdl_10 = LineSDL(Start=divide_curve.Points, Direction=Vector(0, 1, 0), Length=multiplication)  # disabled

curve_19 = Curve(line_sdl_10)  # disabled

curve_20 = Curve(graft(curve_12))  # disabled
divide_curve_5 = DivideCurve(Curve=curve_20, Count=number_3, Kinks=False)  # -> Points, Tangents, Parameters; disabled
curvature_2 = Curvature(Curve=curve_20, Parameter=divide_curve_5.Parameters)  # -> Point, Curvature, Curvature_2; disabled
deconstruct_arc_2 = DeconstructArc(Arc=curvature_2.Curvature_2)  # -> BasePlane, Radius, Angle; disabled
line_2 = Line(StartPoint=curvature_2.Point, EndPoint=deconstruct_arc_2.BasePlane)  # disabled
one_over_x_4 = OneOverX(Value=deconstruct_arc_2.Radius)  # disabled
quick_graph_2 = QuickGraph(one_over_x_4, SortOrder=0)  # disabled
replace_nulls = ReplaceNulls(Items=one_over_x_4, Replacements=0)  # -> Items, Count; disabled
relative_differences_3 = RelativeDifferences(Values=replace_nulls.Items)  # disabled
custom_preview = CustomPreview(Geometry=curve_20, Material=create_material_3)  # disabled
curvature_graph = CurvatureGraph(Curve=curve_20, Density=1, Scale=digit_scroller_8)  # disabled

expression_31 = Expression(O=relative_differences_3, Expression="FORMAT(\"{0:R}\",O)")  # disabled
panel_54 = Panel(expression_31)  # disabled
quick_graph_3 = QuickGraph(relative_differences_3, SortOrder=0)  # disabled

expression_32 = Expression(O=one_over_x_4, Expression="FORMAT(\"{0:R}\",O)")  # disabled
panel_55 = Panel(expression_32)  # disabled

expression_33 = Expression(O=deconstruct_arc_2.Radius, Expression="FORMAT(\"{0:R}\",O)")  # disabled
panel_56 = Panel(expression_33)  # disabled

bounds = Bounds(Numbers=relative_differences_3)  # disabled
remap_numbers = RemapNumbers(Value=relative_differences_3, Source=bounds, Target=Domain(-1, 1))  # -> Mapped, Clipped; disabled

bounds_2 = Bounds(Numbers=one_over_x_4)  # disabled
remap_numbers_2 = RemapNumbers(Value=one_over_x_4, Source=bounds_2, Target=Domain(0, 1))  # -> Mapped, Clipped; disabled

derivatives = Derivatives(Curve=curve_20, Parameter=divide_curve_5.Parameters)  # -> Point, FirstDerivative, SecondDerivative, ThirdDerivative, FourthDerivative, FifthDerivative, SixthDerivative; disabled
quick_graph_4 = QuickGraph(derivatives.SixthDerivative, SortOrder=0)  # disabled
quick_graph_5 = QuickGraph(derivatives.FifthDerivative, SortOrder=0)  # disabled
quick_graph_6 = QuickGraph(derivatives.FourthDerivative, SortOrder=0)  # disabled
quick_graph_7 = QuickGraph(derivatives.ThirdDerivative, SortOrder=0)  # disabled
quick_graph_8 = QuickGraph(derivatives.SecondDerivative, SortOrder=0)  # disabled
quick_graph_9 = QuickGraph(derivatives.FirstDerivative, SortOrder=0)  # disabled
quick_graph_10 = QuickGraph(derivatives.Point, SortOrder=0)  # disabled
length = Length(Curve=curve_20)  # disabled
multiplication_2 = Multiplication(A=remap_numbers.Mapped, B=length)  # disabled
multiplication_3 = Multiplication(A=length, B=remap_numbers_2.Mapped)  # disabled

multiplication_4 = Multiplication(A=multiplication_2, B=number_slider_4)  # disabled

multiplication_5 = Multiplication(A=multiplication_3, B=number_slider_5)  # disabled

line_sdl_11 = LineSDL(Start=curvature_2.Point, Direction=line_2, Length=expr("-ABS(X)", multiplication_5))  # disabled
evaluate_length_11 = EvaluateLength(Curve=line_sdl_11, Length=1, Normalized=True)  # -> Point, Tangent, Parameter; disabled
interpolate_2 = Interpolate(Vertices=evaluate_length_11.Point, Degree=3, Periodic=False, KnotStyle=2)  # -> Curve, Length, Domain; disabled
custom_preview_2 = CustomPreview(Geometry=line_sdl_11, Material=create_material_2)  # disabled
curve_21 = Curve(interpolate_2.Curve)  # disabled
custom_preview_3 = CustomPreview(Geometry=curve_21, Material=create_material)  # disabled

line_sdl_12 = LineSDL(Start=evaluate_length_11.Point, Direction=line_sdl_11, Length=expr("ABS(X)", multiplication_4))  # disabled
nurbs_curve_2 = NurbsCurve(Vertices=evaluate_length_11.Point, Degree=3, Periodic=False)  # -> Curve, Length, Domain; disabled
custom_preview_4 = CustomPreview(Geometry=line_sdl_12, Material=create_material_7)  # disabled
curve_22 = Curve(line_sdl_12)  # disabled
evaluate_length_12 = EvaluateLength(Curve=curve_22, Length=1, Normalized=True)  # -> Point, Tangent, Parameter; disabled
interpolate_3 = Interpolate(Vertices=evaluate_length_12.Point, Degree=3, Periodic=False, KnotStyle=2)  # -> Curve, Length, Domain; disabled
line_sdl_13 = LineSDL(Start=evaluate_length_12.Point, Direction=derivatives.ThirdDerivative, Length=expr("-X", multiplication_4))  # disabled
evaluate_length_13 = EvaluateLength(Curve=line_sdl_13, Length=1, Normalized=True)  # -> Point, Tangent, Parameter; disabled
interpolate_4 = Interpolate(Vertices=evaluate_length_13.Point, Degree=3, Periodic=False, KnotStyle=2)  # -> Curve, Length, Domain; disabled
polyline = PolyLine(Vertices=evaluate_length_12.Point, Closed=False)  # disabled
explode = Explode(Curve=polyline, Recursive=True)  # -> Segments, Vertices; disabled
custom_preview_5 = CustomPreview(Geometry=interpolate_4.Curve, Material=create_material_4)  # disabled
custom_preview_6 = CustomPreview(Geometry=line_sdl_13, Material=create_material_5)  # disabled
custom_preview_7 = CustomPreview(Geometry=interpolate_3.Curve, Material=create_material_6)  # disabled
curve_23 = Curve(flatten(explode.Segments))  # disabled
length_2 = Length(Curve=curve_23)  # disabled
sort_list = SortList(Keys=length_2, ValuesValuesA=curve_23)  # -> Keys, ValuesValuesA; disabled
list_item_4 = ListItem(List=sort_list.Keys, Index=0, Wrap=False)  # disabled
dot_display = DotDisplay(Point=evaluate_length_12.Point, Colour=RGB(194, 194, 194), Size=expr("X/2", list_item_4))  # disabled

expression_34 = Expression(O=sort_list.Keys, Expression="FORMAT(\"{0:R}\",O)")  # disabled
panel_57 = Panel(expression_34)  # disabled

number_11 = Number(number_10)

divide_curve_6 = DivideCurve(Curve=line_sdl_8, Count=number_11, Kinks=False)  # -> Points, Tangents, Parameters

digit_scroller_22 = DigitScroller(Scroller_Digits=12, Scroller_Prefix=" ", Scroller_Radix=5, Scroller_Value=4096)

digit_scroller_23 = DigitScroller(Scroller_Digits=12, Scroller_Prefix=" ", Scroller_Radix=11, Scroller_Value=256)
digit_scroller_24 = DigitScroller(Scroller_Digits=12, Scroller_Prefix=" ", Scroller_Radix=11, Scroller_Value=87)
create_material_26 = CreateMaterial(Diffuse=RGB(222, 222, 222), Specular=RGB(0, 255, 255), Emission=RGB(0, 0, 0), Transparency=0.5, Shine=100)
create_material_27 = CreateMaterial(Diffuse=RGB(247, 247, 247), Specular=RGB(0, 255, 255), Emission=RGB(0, 0, 0), Transparency=0.5, Shine=100)
create_material_28 = CreateMaterial(Diffuse=RGB(176, 176, 176), Specular=RGB(0, 255, 255), Emission=RGB(0, 0, 0), Transparency=0.5, Shine=100)
number_12 = Number(number_10)
number_13 = Number(number_12)

create_material_29 = CreateMaterial(Diffuse=RGB(161, 161, 161), Specular=RGB(0, 255, 255), Emission=RGB(0, 0, 0), Transparency=0.5, Shine=100)
create_material_30 = CreateMaterial(Diffuse=RGB(186, 186, 186), Specular=RGB(0, 255, 255), Emission=RGB(0, 0, 0), Transparency=0.5, Shine=100)

create_material_31 = CreateMaterial(Diffuse=RGB(168, 168, 168), Specular=RGB(0, 255, 255), Emission=RGB(0, 0, 0), Transparency=0.5, Shine=100)
create_material_32 = CreateMaterial(Diffuse=RGB(194, 194, 194), Specular=RGB(0, 255, 255), Emission=RGB(0, 0, 0), Transparency=0.5, Shine=100)

create_material_33 = CreateMaterial(Diffuse=RGB(176, 176, 176), Specular=RGB(0, 255, 255), Emission=RGB(0, 0, 0), Transparency=0.5, Shine=100)
create_material_34 = CreateMaterial(Diffuse=RGB(201, 201, 201), Specular=RGB(0, 255, 255), Emission=RGB(0, 0, 0), Transparency=0.5, Shine=100)

create_material_35 = CreateMaterial(Diffuse=RGB(184, 184, 184), Specular=RGB(0, 255, 255), Emission=RGB(0, 0, 0), Transparency=0.5, Shine=100)
create_material_36 = CreateMaterial(Diffuse=RGB(209, 209, 209), Specular=RGB(0, 255, 255), Emission=RGB(0, 0, 0), Transparency=0.5, Shine=100)

create_material_37 = CreateMaterial(Diffuse=RGB(191, 191, 191), Specular=RGB(0, 255, 255), Emission=RGB(0, 0, 0), Transparency=0.5, Shine=100)
create_material_38 = CreateMaterial(Diffuse=RGB(217, 217, 217), Specular=RGB(0, 255, 255), Emission=RGB(0, 0, 0), Transparency=0.5, Shine=100)

create_material_39 = CreateMaterial(Diffuse=RGB(199, 199, 199), Specular=RGB(0, 255, 255), Emission=RGB(0, 0, 0), Transparency=0.5, Shine=100)
create_material_40 = CreateMaterial(Diffuse=RGB(224, 224, 224), Specular=RGB(0, 255, 255), Emission=RGB(0, 0, 0), Transparency=0.5, Shine=100)

create_material_41 = CreateMaterial(Diffuse=RGB(207, 207, 207), Specular=RGB(0, 255, 255), Emission=RGB(0, 0, 0), Transparency=0.5, Shine=100)
create_material_42 = CreateMaterial(Diffuse=RGB(232, 232, 232), Specular=RGB(0, 255, 255), Emission=RGB(0, 0, 0), Transparency=0.5, Shine=100)

create_material_43 = CreateMaterial(Diffuse=RGB(214, 214, 214), Specular=RGB(0, 255, 255), Emission=RGB(0, 0, 0), Transparency=0.5, Shine=100)
create_material_44 = CreateMaterial(Diffuse=RGB(240, 240, 240), Specular=RGB(0, 255, 255), Emission=RGB(0, 0, 0), Transparency=0.5, Shine=100)
create_material_45 = CreateMaterial(Diffuse=RGB(207, 207, 207), Specular=RGB(0, 255, 255), Emission=RGB(0, 0, 0), Transparency=0.5, Shine=100)
create_material_46 = CreateMaterial(Diffuse=RGB(232, 232, 232), Specular=RGB(0, 255, 255), Emission=RGB(0, 0, 0), Transparency=0.5, Shine=100)

panel_58 = Panel("0.35721403168191375/4/4")
panel_59 = Panel("""1    16    0.35721403168191375
1    256    0.0014014999884235925
1    4096    """)
digit_scroller_25 = DigitScroller(Scroller_Digits=12, Scroller_Prefix="Digit Scroller", Scroller_Radix=1, Scroller_Value=0.00140149998)
number_slider_8 = Slider(256, range=0..65536)
radians_3 = Radians(Degrees=panel_9)

expression_35 = Expression(O=radians_3, Expression="FORMAT(\"{0:0.00000000000000000000}\",O)")
panel_60 = Panel(expression_35)
curve_24 = Curve(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)
number_14 = Number(number_9)

end_points_2 = EndPoints(Curve=curve_17)  # -> Start, End
rectangle_2pt_2 = Rectangle2Pt(Plane=PlaneXY(0, 0, 0), PointA=end_points_2.Start, PointB=end_points_2.End, Radius=0)  # -> Rectangle, Length

series_5 = Series(Start=0, Step=panel_60, Count=number_14)
expression_36 = Expression(O=series_5, Expression="FORMAT(\"{0:R}\",O)")  # disabled
panel_61 = Panel(expression_36)
bounds_3 = Bounds(Numbers=series_5)
one_over_x_5 = OneOverX(Value=number_14)
duplicate_data_4 = DuplicateData(Data=one_over_x_5, Number=number_14, Order=True)

curve_graph_mapper = CurveGraphMapper(Curves=curve_17, Rectangle=rectangle_2pt_2.Rectangle, Values=series_5, Flip=False, Snap=False, TextSize=0.015625)  # -> Mapped, GraphCurves, GraphPoints, ValueLines, ValuePoints, MappedLines, MappedPoints, Boundary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; disabled
graphmapper = GraphMapper(Curve=curve_17, Boundary=rectangle_2pt_2.Rectangle, Numbers=series_5, Input=bounds_3, Output=bounds_3, bobo=False)
stream_filter_2 = StreamFilter(Gate=Slider(1, range=0..1), Stream0=curve_graph_mapper.Mapped, Stream1=graphmapper)

turtle_3 = DotNETVBScriptLEGACY(Forward=duplicate_data_4, Left=stream_filter_2)  # -> Output, Points; inputs Forward: list, Left: list; same code as turtle
point_11 = Point(turtle_3.Points)

expression_37 = Expression(O=turtle_3.Points, Expression="FORMAT(\"{0:R}\",O)")
panel_62 = Panel(expression_37)

interpolate_t_3 = InterpolateT(Vertices=point_11, TangentStart=Vector(0.0625, 0, 0), TangentEnd=Vector(0, 0, 0), KnotStyle=2)  # -> Curve, Length, Domain
evaluate_length_14 = EvaluateLength(Curve=interpolate_t_3.Curve, Length=1, Normalized=True)  # -> Point, Tangent, Parameter
line_sdl_14 = LineSDL(Start=evaluate_length_14.Point, Direction=evaluate_length_14.Tangent, Length=1)
mirror_5 = Mirror(Geometry=interpolate_t_3.Curve, Plane=line_sdl_14)  # -> Geometry, Transform
join_curves_7 = JoinCurves(Curves=[interpolate_t_3.Curve, mirror_5.Geometry], Preserve=False)
evaluate_length_15 = EvaluateLength(Curve=join_curves_7, Length=1, Normalized=True)  # -> Point, Tangent, Parameter
rotate_5 = Rotate(Geometry=join_curves_7, Angle=3.141592654, Plane=evaluate_length_15.Point)  # -> Geometry, Transform
join_curves_8 = JoinCurves(Curves=[join_curves_7, rotate_5.Geometry], Preserve=False)
curve_25 = Curve(join_curves_8)

evaluate_length_16 = EvaluateLength(Curve=join_curves_8, Length=1, Normalized=True)  # -> Point, Tangent, Parameter
deconstruct_8 = Deconstruct(Point=evaluate_length_16.Point)  # -> XComponent, YComponent, ZComponent
expression_38 = Expression(O=deconstruct_8.YComponent, Expression="FORMAT(\"{0:R}\",O)")
expression_39 = Expression(O=deconstruct_8.XComponent, Expression="FORMAT(\"{0:R}\",O)")
expression_40 = Expression(O=deconstruct_8.ZComponent, Expression="FORMAT(\"{0:R}\",O)")
panel_63 = Panel(expression_38)
panel_64 = Panel(expression_39)
panel_65 = Panel(expression_40)
addition_3 = Addition(A=panel_63, B=panel_64)
expression_41 = Expression(O=addition_3, Expression="FORMAT(\"{0:R}\",O)")
panel_66 = Panel(expression_41)
division_5 = Division(A=panel_66, B=2)
expression_42 = Expression(O=division_5, Expression="FORMAT(\"{0:R}\",O)")
panel_67 = Panel(expression_42)
scale_8 = Scale(Geometry=point_11, Center=Point(0, 0, 0), Factor=expr("1/X", panel_67))  # -> Geometry, Transform
scale_9 = Scale(Geometry=curve_25, Center=Point(0, 0, 0), Factor=expr("1/X", panel_67))  # -> Geometry, Transform
evaluate_length_17 = EvaluateLength(Curve=scale_9.Geometry, Length=1, Normalized=True)  # -> Point, Tangent, Parameter
deconstruct_9 = Deconstruct(Point=evaluate_length_17.Point)  # -> XComponent, YComponent, ZComponent
expression_43 = Expression(O=deconstruct_9.YComponent, Expression="FORMAT(\"{0:R}\",O)")
expression_44 = Expression(O=deconstruct_9.XComponent, Expression="FORMAT(\"{0:R}\",O)")
expression_45 = Expression(O=deconstruct_9.ZComponent, Expression="FORMAT(\"{0:R}\",O)")
panel_68 = Panel(expression_43)
panel_69 = Panel(expression_44)
panel_70 = Panel(expression_45)
division_6 = Division(A=panel_64, B=panel_63)
expression_46 = Expression(O=division_6, Expression="FORMAT(\"{0:R}\",O)")
panel_71 = Panel(expression_46)
curve_26 = Curve(scale_9.Geometry)
point_12 = Point(scale_8.Geometry)

move_2 = Move(Geometry=curve_26, Motion=Vector(0, 1, 0))  # -> Geometry, Transform
mirror_6 = Mirror(Geometry=curve_26, Plane=PlaneYZ(0, 0, 0))  # -> Geometry, Transform
curve_27 = Curve(move_2.Geometry)

curve_28 = Curve(curve_26)
end_points_3 = EndPoints(Curve=curve_28)  # -> Start, End
rectangle_2pt_3 = Rectangle2Pt(Plane=PlaneXY(0, 0, 0), PointA=end_points_3.Start, PointB=end_points_3.End, Radius=0)  # -> Rectangle, Length
deconstuct_rectangle_2 = DeconstuctRectangle(Rectangle=rectangle_2pt_3.Rectangle)  # -> BasePlane, XInterval, YInterval
deconstruct_domain_4 = DeconstructDomain(Domain=deconstuct_rectangle_2.YInterval)  # -> Start, End
deconstruct_domain_5 = DeconstructDomain(Domain=deconstuct_rectangle_2.XInterval)  # -> Start, End
scale_nu_2 = ScaleNU(
    Geometry=curve_26,
    Plane=PlaneXY(0, 0, 0),
    ScaleX=expr("1/X", deconstruct_domain_5.End),
    ScaleY=expr("1/X", deconstruct_domain_4.End),
    ScaleZ=1)  # -> Geometry, Transform
curve_29 = Curve(scale_nu_2.Geometry)
move_3 = Move(Geometry=curve_29, Motion=Vector(0, 1, 0))  # -> Geometry, Transform
curve_30 = Curve(move_3.Geometry)

digit_scroller_26 = DigitScroller(Scroller_Digits=12, Scroller_Prefix=" ", Scroller_Radix=2, Scroller_Value=20.9312132)
curve_31 = Curve(curve_26)
scale_10 = Scale(Geometry=curve_31, Center=Point(0, 0, 0), Factor=expr("2^X", "6.93121320041998779"))  # -> Geometry, Transform
curve_32 = Curve(scale_10.Geometry)

digit_scroller_27 = DigitScroller(Scroller_Digits=12, Scroller_Prefix="Digit Scroller", Scroller_Radix=1, Scroller_Value=0.00140149998)
number_slider_9 = Slider(256, range=0..65536)
radians_4 = Radians(Degrees=panel_10)

expression_47 = Expression(O=radians_4, Expression="FORMAT(\"{0:0.00000000000000000000}\",O)")
panel_75 = Panel(expression_47)
curve_33 = Curve(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)
number_15 = Number(number_9)

end_points_4 = EndPoints(Curve=curve_32)  # -> Start, End
rectangle_2pt_4 = Rectangle2Pt(Plane=PlaneXY(0, 0, 0), PointA=end_points_4.Start, PointB=end_points_4.End, Radius=0)  # -> Rectangle, Length

series_6 = Series(Start=0, Step=panel_75, Count=number_15)
expression_48 = Expression(O=series_6, Expression="FORMAT(\"{0:R}\",O)")  # disabled
panel_76 = Panel(expression_48)
bounds_4 = Bounds(Numbers=series_6)
one_over_x_6 = OneOverX(Value=number_15)
duplicate_data_5 = DuplicateData(Data=one_over_x_6, Number=number_15, Order=True)

curve_graph_mapper_2 = CurveGraphMapper(Curves=curve_32, Rectangle=rectangle_2pt_4.Rectangle, Values=series_6, Flip=False, Snap=True, TextSize=0.015625)  # -> Mapped, GraphCurves, GraphPoints, ValueLines, ValuePoints, MappedLines, MappedPoints, Boundary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; disabled
graphmapper_2 = GraphMapper(Curve=curve_32, Boundary=rectangle_2pt_4.Rectangle, Numbers=series_6, Input=bounds_4, Output=bounds_4, bobo=False)
stream_filter_3 = StreamFilter(Gate=Slider(1, range=0..1), Stream0=curve_graph_mapper_2.Mapped, Stream1=graphmapper_2)

turtle_4 = DotNETVBScriptLEGACY(Forward=duplicate_data_5, Left=stream_filter_3)  # -> Output, Points; inputs Forward: list, Left: list; same code as turtle
point_13 = Point(turtle_4.Points)

expression_49 = Expression(O=turtle_4.Points, Expression="FORMAT(\"{0:R}\",O)")
panel_77 = Panel(expression_49)

interpolate_t_4 = InterpolateT(Vertices=point_13, TangentStart=Vector(0.0625, 0, 0), TangentEnd=Vector(0, 0, 0), KnotStyle=2)  # -> Curve, Length, Domain
evaluate_length_18 = EvaluateLength(Curve=interpolate_t_4.Curve, Length=1, Normalized=True)  # -> Point, Tangent, Parameter
line_sdl_15 = LineSDL(Start=evaluate_length_18.Point, Direction=evaluate_length_18.Tangent, Length=1)
mirror_7 = Mirror(Geometry=interpolate_t_4.Curve, Plane=line_sdl_15)  # -> Geometry, Transform
join_curves_9 = JoinCurves(Curves=[interpolate_t_4.Curve, mirror_7.Geometry], Preserve=False)
evaluate_length_19 = EvaluateLength(Curve=join_curves_9, Length=1, Normalized=True)  # -> Point, Tangent, Parameter
rotate_6 = Rotate(Geometry=join_curves_9, Angle=3.141592654, Plane=evaluate_length_19.Point)  # -> Geometry, Transform
join_curves_10 = JoinCurves(Curves=[join_curves_9, rotate_6.Geometry], Preserve=False)
curve_34 = Curve(join_curves_10)

evaluate_length_20 = EvaluateLength(Curve=join_curves_10, Length=1, Normalized=True)  # -> Point, Tangent, Parameter
deconstruct_10 = Deconstruct(Point=evaluate_length_20.Point)  # -> XComponent, YComponent, ZComponent
expression_50 = Expression(O=deconstruct_10.YComponent, Expression="FORMAT(\"{0:R}\",O)")
expression_51 = Expression(O=deconstruct_10.XComponent, Expression="FORMAT(\"{0:R}\",O)")
expression_52 = Expression(O=deconstruct_10.ZComponent, Expression="FORMAT(\"{0:R}\",O)")
panel_78 = Panel(expression_50)
panel_79 = Panel(expression_51)
panel_80 = Panel(expression_52)
addition_4 = Addition(A=panel_78, B=panel_79)
expression_53 = Expression(O=addition_4, Expression="FORMAT(\"{0:R}\",O)")
panel_81 = Panel(expression_53)
division_7 = Division(A=panel_81, B=2)
expression_54 = Expression(O=division_7, Expression="FORMAT(\"{0:R}\",O)")
panel_82 = Panel(expression_54)
scale_11 = Scale(Geometry=point_13, Center=Point(0, 0, 0), Factor=expr("1/X", panel_82))  # -> Geometry, Transform
scale_12 = Scale(Geometry=curve_34, Center=Point(0, 0, 0), Factor=expr("1/X", panel_82))  # -> Geometry, Transform
evaluate_length_21 = EvaluateLength(Curve=scale_12.Geometry, Length=1, Normalized=True)  # -> Point, Tangent, Parameter
deconstruct_11 = Deconstruct(Point=evaluate_length_21.Point)  # -> XComponent, YComponent, ZComponent
expression_55 = Expression(O=deconstruct_11.YComponent, Expression="FORMAT(\"{0:R}\",O)")
expression_56 = Expression(O=deconstruct_11.XComponent, Expression="FORMAT(\"{0:R}\",O)")
expression_57 = Expression(O=deconstruct_11.ZComponent, Expression="FORMAT(\"{0:R}\",O)")
panel_83 = Panel(expression_55)
panel_84 = Panel(expression_56)
panel_85 = Panel(expression_57)
division_8 = Division(A=panel_79, B=panel_78)
expression_58 = Expression(O=division_8, Expression="FORMAT(\"{0:R}\",O)")
panel_86 = Panel(expression_58)
curve_35 = Curve(scale_12.Geometry)
point_14 = Point(scale_11.Geometry)

move_4 = Move(Geometry=curve_35, Motion=Vector(0, 2, 0))  # -> Geometry, Transform
mirror_8 = Mirror(Geometry=curve_35, Plane=PlaneYZ(0, 0, 0))  # -> Geometry, Transform
curve_36 = Curve(move_4.Geometry)

digit_scroller_28 = DigitScroller(Scroller_Digits=12, Scroller_Prefix=" ", Scroller_Radix=2, Scroller_Value=27.9312132)
curve_37 = Curve(curve_35)
scale_13 = Scale(Geometry=curve_37, Center=Point(0, 0, 0), Factor=expr("2^X", "7.93121320041998779"))  # -> Geometry, Transform
curve_38 = Curve(scale_13.Geometry)

panel_88 = Panel(panel_7)
panel_89 = Panel("""3    16    
3    256    0.001373312092932693349
3    4096    """)
digit_scroller_29 = DigitScroller(Scroller_Digits=12, Scroller_Prefix="Digit Scroller", Scroller_Radix=1, Scroller_Value=0.00137331209)
number_slider_10 = Slider(256, range=0..65536)
radians_5 = Radians(Degrees=panel_88)

expression_59 = Expression(O=radians_5, Expression="FORMAT(\"{0:0.00000000000000000000}\",O)")
panel_90 = Panel(expression_59)
curve_39 = Curve(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)
number_16 = Number(number_9)

end_points_5 = EndPoints(Curve=curve_38)  # -> Start, End
rectangle_2pt_5 = Rectangle2Pt(Plane=PlaneXY(0, 0, 0), PointA=end_points_5.Start, PointB=end_points_5.End, Radius=0)  # -> Rectangle, Length

one_over_x_7 = OneOverX(Value=number_16)
duplicate_data_6 = DuplicateData(Data=one_over_x_7, Number=number_16, Order=True)
series_7 = Series(Start=0, Step=panel_90, Count=number_16)
expression_60 = Expression(O=series_7, Expression="FORMAT(\"{0:R}\",O)")  # disabled
panel_91 = Panel(expression_60)
bounds_5 = Bounds(Numbers=series_7)

curve_graph_mapper_3 = CurveGraphMapper(Curves=curve_38, Rectangle=rectangle_2pt_5.Rectangle, Values=series_7, Flip=False, Snap=True, TextSize=0.015625)  # -> Mapped, GraphCurves, GraphPoints, ValueLines, ValuePoints, MappedLines, MappedPoints, Boundary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; disabled
graphmapper_3 = GraphMapper(Curve=curve_38, Boundary=rectangle_2pt_5.Rectangle, Numbers=series_7, Input=bounds_5, Output=bounds_5, bobo=False)
stream_filter_4 = StreamFilter(Gate=Slider(1, range=0..1), Stream0=curve_graph_mapper_3.Mapped, Stream1=graphmapper_3)

turtle_5 = DotNETVBScriptLEGACY(Forward=duplicate_data_6, Left=stream_filter_4)  # -> Output, Points; inputs Forward: list, Left: list; same code as turtle
point_15 = Point(turtle_5.Points)

expression_61 = Expression(O=turtle_5.Points, Expression="FORMAT(\"{0:R}\",O)")
panel_92 = Panel(expression_61)

interpolate_t_5 = InterpolateT(Vertices=point_15, TangentStart=Vector(1, 0, 0), TangentEnd=Vector(0, 0, 0), KnotStyle=2)  # -> Curve, Length, Domain
evaluate_length_22 = EvaluateLength(Curve=interpolate_t_5.Curve, Length=1, Normalized=True)  # -> Point, Tangent, Parameter
line_sdl_16 = LineSDL(Start=evaluate_length_22.Point, Direction=evaluate_length_22.Tangent, Length=1)
mirror_9 = Mirror(Geometry=interpolate_t_5.Curve, Plane=line_sdl_16)  # -> Geometry, Transform
join_curves_11 = JoinCurves(Curves=[interpolate_t_5.Curve, mirror_9.Geometry], Preserve=False)
evaluate_length_23 = EvaluateLength(Curve=join_curves_11, Length=1, Normalized=True)  # -> Point, Tangent, Parameter
rotate_7 = Rotate(Geometry=join_curves_11, Angle=3.141592654, Plane=evaluate_length_23.Point)  # -> Geometry, Transform
join_curves_12 = JoinCurves(Curves=[join_curves_11, rotate_7.Geometry], Preserve=False)
curve_40 = Curve(join_curves_12)

evaluate_length_24 = EvaluateLength(Curve=join_curves_12, Length=1, Normalized=True)  # -> Point, Tangent, Parameter
deconstruct_12 = Deconstruct(Point=evaluate_length_24.Point)  # -> XComponent, YComponent, ZComponent
expression_62 = Expression(O=deconstruct_12.YComponent, Expression="FORMAT(\"{0:R}\",O)")
expression_63 = Expression(O=deconstruct_12.XComponent, Expression="FORMAT(\"{0:R}\",O)")
expression_64 = Expression(O=deconstruct_12.ZComponent, Expression="FORMAT(\"{0:R}\",O)")
panel_93 = Panel(expression_62)
panel_94 = Panel(expression_63)
panel_95 = Panel(expression_64)
division_9 = Division(A=panel_94, B=panel_93)
expression_65 = Expression(O=division_9, Expression="FORMAT(\"{0:R}\",O)")
panel_96 = Panel(expression_65)
addition_5 = Addition(A=panel_93, B=panel_94)
expression_66 = Expression(O=addition_5, Expression="FORMAT(\"{0:R}\",O)")
panel_98 = Panel(expression_66)
division_10 = Division(A=panel_98, B=2)
expression_67 = Expression(O=division_10, Expression="FORMAT(\"{0:R}\",O)")
panel_99 = Panel(expression_67)
scale_14 = Scale(Geometry=interpolate_t_5.Curve, Center=Point(0, 0, 0), Factor=expr("1/X", panel_99))  # -> Geometry, Transform; disabled
scale_15 = Scale(Geometry=curve_40, Center=Point(0, 0, 0), Factor=expr("1/X", panel_99))  # -> Geometry, Transform
scale_16 = Scale(Geometry=point_15, Center=Point(0, 0, 0), Factor=expr("1/X", panel_99))  # -> Geometry, Transform
evaluate_length_25 = EvaluateLength(Curve=scale_15.Geometry, Length=1, Normalized=True)  # -> Point, Tangent, Parameter
deconstruct_13 = Deconstruct(Point=evaluate_length_25.Point)  # -> XComponent, YComponent, ZComponent
expression_68 = Expression(O=deconstruct_13.YComponent, Expression="FORMAT(\"{0:R}\",O)")
expression_69 = Expression(O=deconstruct_13.XComponent, Expression="FORMAT(\"{0:R}\",O)")
expression_70 = Expression(O=deconstruct_13.ZComponent, Expression="FORMAT(\"{0:R}\",O)")
panel_100 = Panel(expression_68)
panel_101 = Panel(expression_69)
panel_102 = Panel(expression_70)
point_16 = Point(scale_16.Geometry)
curve_41 = Curve(scale_15.Geometry)

evaluate_length_26 = EvaluateLength(Curve=curve_41, Length=1, Normalized=True)  # -> Point, Tangent, Parameter
yz_plane_4 = YZPlane(Origin=evaluate_length_26.Point)

move_5 = Move(Geometry=curve_41, Motion=Vector(0, 3, 0))  # -> Geometry, Transform
mirror_10 = Mirror(Geometry=curve_41, Plane=yz_plane_4)  # -> Geometry, Transform

join_curves_13 = JoinCurves(Curves=[curve_41, mirror_10.Geometry], Preserve=False)  # disabled

digit_scroller_30 = DigitScroller(Scroller_Digits=12, Scroller_Prefix=" ", Scroller_Radix=2, Scroller_Value=27.9312132)
curve_42 = Curve(curve_41)
scale_17 = Scale(Geometry=curve_42, Center=Point(0, 0, 0), Factor=expr("2^X", "7.93121320041998779"))  # -> Geometry, Transform
curve_43 = Curve(scale_17.Geometry)

digit_scroller_31 = DigitScroller(Scroller_Digits=12, Scroller_Prefix=" ", Scroller_Radix=2, Scroller_Value=27.9312132)
curve_44 = Curve(curve_41)
scale_18 = Scale(Geometry=curve_44, Center=Point(0, 0, 0), Factor=expr("2^X", "7.93121320041998779"))  # -> Geometry, Transform
curve_45 = Curve(scale_18.Geometry)

panel_103 = Panel(panel_7)
digit_scroller_32 = DigitScroller(Scroller_Digits=12, Scroller_Prefix="Digit Scroller", Scroller_Radix=1, Scroller_Value=0.00137331209)
number_slider_11 = Slider(256, range=0..65536)
radians_6 = Radians(Degrees=panel_103)

expression_71 = Expression(O=radians_6, Expression="FORMAT(\"{0:0.00000000000000000000}\",O)")
panel_105 = Panel(expression_71)
curve_46 = Curve(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)
number_17 = Number(number_9)

end_points_6 = EndPoints(Curve=curve_43)  # -> Start, End
rectangle_2pt_6 = Rectangle2Pt(Plane=PlaneXY(0, 0, 0), PointA=end_points_6.Start, PointB=end_points_6.End, Radius=0)  # -> Rectangle, Length

one_over_x_8 = OneOverX(Value=number_17)
duplicate_data_7 = DuplicateData(Data=one_over_x_8, Number=number_17, Order=True)
series_8 = Series(Start=0, Step=panel_105, Count=number_17)
expression_72 = Expression(O=series_8, Expression="FORMAT(\"{0:R}\",O)")  # disabled
panel_106 = Panel(expression_72)
bounds_6 = Bounds(Numbers=series_8)

curve_graph_mapper_4 = CurveGraphMapper(Curves=curve_43, Rectangle=rectangle_2pt_6.Rectangle, Values=series_8, Flip=False, Snap=True, TextSize=0.015625)  # -> Mapped, GraphCurves, GraphPoints, ValueLines, ValuePoints, MappedLines, MappedPoints, Boundary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; disabled
graphmapper_4 = GraphMapper(Curve=curve_43, Boundary=rectangle_2pt_6.Rectangle, Numbers=series_8, Input=bounds_6, Output=bounds_6, bobo=False)
stream_filter_5 = StreamFilter(Gate=Slider(1, range=0..1), Stream0=curve_graph_mapper_4.Mapped, Stream1=graphmapper_4)

turtle_6 = DotNETVBScriptLEGACY(Forward=duplicate_data_7, Left=stream_filter_5)  # -> Output, Points; inputs Forward: list, Left: list; same code as turtle
point_17 = Point(turtle_6.Points)

expression_73 = Expression(O=turtle_6.Points, Expression="FORMAT(\"{0:R}\",O)")
panel_107 = Panel(expression_73)

interpolate_t_6 = InterpolateT(Vertices=point_17, TangentStart=Vector(1, 0, 0), TangentEnd=Vector(0, 0, 0), KnotStyle=2)  # -> Curve, Length, Domain
evaluate_length_27 = EvaluateLength(Curve=interpolate_t_6.Curve, Length=1, Normalized=True)  # -> Point, Tangent, Parameter
line_sdl_17 = LineSDL(Start=evaluate_length_27.Point, Direction=evaluate_length_27.Tangent, Length=1)
mirror_11 = Mirror(Geometry=interpolate_t_6.Curve, Plane=line_sdl_17)  # -> Geometry, Transform
join_curves_14 = JoinCurves(Curves=[interpolate_t_6.Curve, mirror_11.Geometry], Preserve=False)
evaluate_length_28 = EvaluateLength(Curve=join_curves_14, Length=1, Normalized=True)  # -> Point, Tangent, Parameter
rotate_8 = Rotate(Geometry=join_curves_14, Angle=3.141592654, Plane=evaluate_length_28.Point)  # -> Geometry, Transform
join_curves_15 = JoinCurves(Curves=[join_curves_14, rotate_8.Geometry], Preserve=False)
curve_47 = Curve(join_curves_15)

evaluate_length_29 = EvaluateLength(Curve=join_curves_15, Length=1, Normalized=True)  # -> Point, Tangent, Parameter
deconstruct_14 = Deconstruct(Point=evaluate_length_29.Point)  # -> XComponent, YComponent, ZComponent
expression_74 = Expression(O=deconstruct_14.YComponent, Expression="FORMAT(\"{0:R}\",O)")
expression_75 = Expression(O=deconstruct_14.XComponent, Expression="FORMAT(\"{0:R}\",O)")
expression_76 = Expression(O=deconstruct_14.ZComponent, Expression="FORMAT(\"{0:R}\",O)")
panel_108 = Panel(expression_74)
panel_109 = Panel(expression_75)
panel_110 = Panel(expression_76)
division_11 = Division(A=panel_109, B=panel_108)
expression_77 = Expression(O=division_11, Expression="FORMAT(\"{0:R}\",O)")
panel_111 = Panel(expression_77)
addition_6 = Addition(A=panel_108, B=panel_109)
expression_78 = Expression(O=addition_6, Expression="FORMAT(\"{0:R}\",O)")
panel_113 = Panel(expression_78)
division_12 = Division(A=panel_113, B=2)
expression_79 = Expression(O=division_12, Expression="FORMAT(\"{0:R}\",O)")
panel_114 = Panel(expression_79)
scale_19 = Scale(Geometry=interpolate_t_6.Curve, Center=Point(0, 0, 0), Factor=expr("1/X", panel_114))  # -> Geometry, Transform; disabled
scale_20 = Scale(Geometry=curve_47, Center=Point(0, 0, 0), Factor=expr("1/X", panel_114))  # -> Geometry, Transform
scale_21 = Scale(Geometry=point_17, Center=Point(0, 0, 0), Factor=expr("1/X", panel_114))  # -> Geometry, Transform
evaluate_length_30 = EvaluateLength(Curve=scale_20.Geometry, Length=1, Normalized=True)  # -> Point, Tangent, Parameter
deconstruct_15 = Deconstruct(Point=evaluate_length_30.Point)  # -> XComponent, YComponent, ZComponent
expression_80 = Expression(O=deconstruct_15.YComponent, Expression="FORMAT(\"{0:R}\",O)")
expression_81 = Expression(O=deconstruct_15.XComponent, Expression="FORMAT(\"{0:R}\",O)")
expression_82 = Expression(O=deconstruct_15.ZComponent, Expression="FORMAT(\"{0:R}\",O)")
panel_115 = Panel(expression_80)
panel_116 = Panel(expression_81)
panel_117 = Panel(expression_82)
point_18 = Point(scale_21.Geometry)
curve_48 = Curve(scale_20.Geometry)

entwine = Entwine(Branch0X=curve_12, Branch1X=curve_26, Branch2X=curve_35, Branch3X=curve_41, Branch4X=curve_48, FlattenInputs=False)
evaluate_length_31 = EvaluateLength(Curve=curve_48, Length=1, Normalized=True)  # -> Point, Tangent, Parameter
yz_plane_5 = YZPlane(Origin=evaluate_length_31.Point)

move_6 = Move(Geometry=curve_48, Motion=Vector(0, 3, 0))  # -> Geometry, Transform
mirror_12 = Mirror(Geometry=curve_48, Plane=yz_plane_5)  # -> Geometry, Transform

join_curves_16 = JoinCurves(Curves=[curve_48, mirror_12.Geometry], Preserve=False)  # disabled

digit_scroller_33 = DigitScroller(Scroller_Digits=12, Scroller_Prefix="Digit Scroller", Scroller_Radix=1, Scroller_Value=0.00137331209)
number_slider_12 = Slider(256, range=0..65536)
radians_7 = Radians(Degrees="0.001373312092932693349")

expression_83 = Expression(O=radians_7, Expression="FORMAT(\"{0:0.00000000000000000000}\",O)")
panel_119 = Panel(expression_83)
curve_49 = Curve(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)
number_18 = Number(number_9)

end_points_7 = EndPoints(Curve=curve_45)  # -> Start, End
rectangle_2pt_7 = Rectangle2Pt(Plane=PlaneXY(0, 0, 0), PointA=end_points_7.Start, PointB=end_points_7.End, Radius=0)  # -> Rectangle, Length

one_over_x_9 = OneOverX(Value=number_18)
duplicate_data_8 = DuplicateData(Data=one_over_x_9, Number=number_18, Order=True)
series_9 = Series(Start=0, Step=panel_119, Count=number_18)
expression_84 = Expression(O=series_9, Expression="FORMAT(\"{0:R}\",O)")  # disabled
panel_120 = Panel(expression_84)
bounds_7 = Bounds(Numbers=series_9)

curve_graph_mapper_5 = CurveGraphMapper(Curves=curve_45, Rectangle=rectangle_2pt_7.Rectangle, Values=series_9, Flip=False, Snap=True, TextSize=0.015625)  # -> Mapped, GraphCurves, GraphPoints, ValueLines, ValuePoints, MappedLines, MappedPoints, Boundary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; disabled
graphmapper_5 = GraphMapper(Curve=curve_45, Boundary=rectangle_2pt_7.Rectangle, Numbers=series_9, Input=bounds_7, Output=bounds_7, bobo=False)
stream_filter_6 = StreamFilter(Gate=Slider(1, range=0..1), Stream0=curve_graph_mapper_5.Mapped, Stream1=graphmapper_5)

turtle_7 = DotNETVBScriptLEGACY(Forward=duplicate_data_8, Left=stream_filter_6)  # -> Output, Points; inputs Forward: list, Left: list; same code as turtle
point_19 = Point(turtle_7.Points)

expression_85 = Expression(O=turtle_7.Points, Expression="FORMAT(\"{0:R}\",O)")
panel_121 = Panel(expression_85)

interpolate_t_7 = InterpolateT(Vertices=point_19, TangentStart=Vector(1, 0, 0), TangentEnd=Vector(0, 0, 0), KnotStyle=2)  # -> Curve, Length, Domain
evaluate_length_32 = EvaluateLength(Curve=interpolate_t_7.Curve, Length=1, Normalized=True)  # -> Point, Tangent, Parameter
line_sdl_18 = LineSDL(Start=evaluate_length_32.Point, Direction=evaluate_length_32.Tangent, Length=1)
mirror_13 = Mirror(Geometry=interpolate_t_7.Curve, Plane=line_sdl_18)  # -> Geometry, Transform
join_curves_17 = JoinCurves(Curves=[interpolate_t_7.Curve, mirror_13.Geometry], Preserve=False)
evaluate_length_33 = EvaluateLength(Curve=join_curves_17, Length=1, Normalized=True)  # -> Point, Tangent, Parameter
rotate_9 = Rotate(Geometry=join_curves_17, Angle=3.141592654, Plane=evaluate_length_33.Point)  # -> Geometry, Transform
join_curves_18 = JoinCurves(Curves=[join_curves_17, rotate_9.Geometry], Preserve=False)
curve_50 = Curve(join_curves_18)

evaluate_length_34 = EvaluateLength(Curve=join_curves_18, Length=1, Normalized=True)  # -> Point, Tangent, Parameter
deconstruct_16 = Deconstruct(Point=evaluate_length_34.Point)  # -> XComponent, YComponent, ZComponent
expression_86 = Expression(O=deconstruct_16.YComponent, Expression="FORMAT(\"{0:R}\",O)")
expression_87 = Expression(O=deconstruct_16.XComponent, Expression="FORMAT(\"{0:R}\",O)")
expression_88 = Expression(O=deconstruct_16.ZComponent, Expression="FORMAT(\"{0:R}\",O)")
panel_122 = Panel(expression_86)
panel_123 = Panel(expression_87)
panel_124 = Panel(expression_88)
division_13 = Division(A=panel_123, B=panel_122)
expression_89 = Expression(O=division_13, Expression="FORMAT(\"{0:R}\",O)")
panel_125 = Panel(expression_89)
addition_7 = Addition(A=panel_122, B=panel_123)
expression_90 = Expression(O=addition_7, Expression="FORMAT(\"{0:R}\",O)")
panel_127 = Panel(expression_90)
division_14 = Division(A=panel_127, B=2)
expression_91 = Expression(O=division_14, Expression="FORMAT(\"{0:R}\",O)")
panel_128 = Panel(expression_91)
scale_22 = Scale(Geometry=interpolate_t_7.Curve, Center=Point(0, 0, 0), Factor=expr("1/X", panel_128))  # -> Geometry, Transform; disabled
scale_23 = Scale(Geometry=curve_50, Center=Point(0, 0, 0), Factor=expr("1/X", panel_128))  # -> Geometry, Transform
scale_24 = Scale(Geometry=point_19, Center=Point(0, 0, 0), Factor=expr("1/X", panel_128))  # -> Geometry, Transform
evaluate_length_35 = EvaluateLength(Curve=scale_23.Geometry, Length=1, Normalized=True)  # -> Point, Tangent, Parameter
deconstruct_17 = Deconstruct(Point=evaluate_length_35.Point)  # -> XComponent, YComponent, ZComponent
expression_92 = Expression(O=deconstruct_17.YComponent, Expression="FORMAT(\"{0:R}\",O)")
expression_93 = Expression(O=deconstruct_17.XComponent, Expression="FORMAT(\"{0:R}\",O)")
expression_94 = Expression(O=deconstruct_17.ZComponent, Expression="FORMAT(\"{0:R}\",O)")
panel_129 = Panel(expression_92)
panel_130 = Panel(expression_93)
panel_131 = Panel(expression_94)
point_20 = Point(scale_24.Geometry)
curve_51 = Curve(scale_23.Geometry)

move_7 = Move(Geometry=curve_51, Motion=Vector(0, 3, 0))  # -> Geometry, Transform
evaluate_length_36 = EvaluateLength(Curve=curve_51, Length=1, Normalized=True)  # -> Point, Tangent, Parameter
yz_plane_6 = YZPlane(Origin=evaluate_length_36.Point)
mirror_14 = Mirror(Geometry=curve_51, Plane=yz_plane_6)  # -> Geometry, Transform
join_curves_19 = JoinCurves(Curves=[curve_51, mirror_14.Geometry], Preserve=False)  # disabled

curve_52 = Curve(curve_51)

curve_53 = Curve(graft(curve_52))
entwine_2 = Entwine(
    Branch0X=curve_12,
    Branch1X=curve_14,
    Branch2X=curve_27,
    Branch3X=curve_30,
    Branch4X=curve_36,
    Branch5X=curve_52,
    FlattenInputs=False)
curve_domain_2 = CurveDomain(Curve=curve_51)  # -> Curve, Domain
deconstruct_domain_6 = DeconstructDomain(Domain=curve_domain_2.Domain)  # -> Start, End
construct_domain_3 = ConstructDomain(DomainStart=expr("X/2", deconstruct_domain_6.End), DomainEnd=deconstruct_domain_6.End)
sub_curve_2 = SubCurve(BaseCurve=curve_51, Domain=construct_domain_3)

button_3 = Button()  # disabled
file_path_3 = FilePath("C:\VSC.O____STNEMGES_48361____DIOMGIS_ERUTAWRUC_RAENIL_NOITISNART_EGDE_LUF____O____FUL_EDGE_TRANSITION_LINEAR_CURWATURE_SIGMOID____16384_SEGMENTS____O.CSV")  # disabled
curve_54 = Curve(curve_52)  # disabled
number_19 = Number(number_10)  # disabled
divide_curve_7 = DivideCurve(Curve=curve_54, Count=number_19, Kinks=False)  # -> Points, Tangents, Parameters; disabled
deconstruct_18 = Deconstruct(Point=divide_curve_7.Points)  # -> graft(XComponent), graft(YComponent), ZComponent; disabled
expression_95 = Expression(Y=deconstruct_18.YComponent, Expression="FORMAT(\"{0:R}\",ROUND(Y, 15))")  # -> simplify(Result); disabled
expression_96 = Expression(X=deconstruct_18.XComponent, Expression="FORMAT(\"{0:R}\",ROUND(X, 15))")  # -> simplify(Result); disabled
expression_97 = Expression(X=deconstruct_18.XComponent, Expression="FORMAT(\"{0:R}\",X)")  # -> simplify(Result); disabled
panel_132 = Panel(expression_97)  # disabled
expression_98 = Expression(Y=deconstruct_18.YComponent, Expression="FORMAT(\"{0:R}\",Y)")  # -> simplify(Result); disabled
list_length_5 = ListLength(List=divide_curve_7.Points)  # disabled
duplicate_data_9 = DuplicateData(Data=",", Number=list_length_5, Order=True)  # -> simplify(graft(Data)); disabled
panel_133 = Panel(duplicate_data_9)  # disabled
panel_134 = Panel(expression_98)  # disabled
concatenate_2 = Concatenate(FragmentA=panel_132, FragmentB=panel_133, FragmentA_2=panel_134)  # -> flatten(Result); disabled
panel_135 = Panel(concatenate_2)  # disabled
txtwriter_3 = VBScript(filePath=file_path_3, data=flatten(panel_135), activate=button_3)  # -> out, A; inputs data: list; disabled; same code as txtwriter

rotate_10 = Rotate(Geometry=sub_curve_2, Angle=3.141592654, Plane=evaluate_length.Point)  # -> Geometry, Transform
evaluate_length_37 = EvaluateLength(Curve=rotate_10.Geometry, Length=0, Normalized=True)  # -> Point, Tangent, Parameter
mirror_15 = Mirror(Geometry=curve_51, Plane=line)  # -> Geometry, Transform
join_curves_20 = JoinCurves(Curves=[curve_51, rotate_10.Geometry], Preserve=False)
scale_25 = Scale(Geometry=join_curves_20, Center=Point(0, 0, 0), Factor=expr("X/1.5", 1))  # -> Geometry, Transform
rotate_11 = Rotate(Geometry=scale_25.Geometry, Angle=1.570796327, Plane=yz_plane)  # -> Geometry, Transform
extrude = Extrude(Base=scale_25.Geometry, Direction=Vector(0, 0, 1))
scale_26 = Scale(Geometry=extrude, Center=Point(0, 0, 0), Factor=expr("2^X", number_slider))  # -> Geometry, Transform
extrude_2 = Extrude(Base=rotate_11.Geometry, Direction=Vector(0, 1, 0))
rotate_direction = RotateDirection(Geometry=curve_51, Center=Point(0, 0, 0), From=Vector(1, 0, 0), To=Vector(0, 0, 1))  # -> Geometry, Transform
move_8 = Move(Geometry=rotate_direction.Geometry, Motion=Vector(1, 0, 0))  # -> Geometry, Transform
scale_27 = Scale(Geometry=extrude_2, Center=Point(0, 0, 0), Factor=expr("2^X", number_slider))  # -> Geometry, Transform
project = Project(Curve=scale_25.Geometry, Brep=extrude_2, Direction=Vector(0, 0, 1))  # disabled
brep_brep = BrepBrep(BrepA=scale_26.Geometry, BrepB=scale_27.Geometry)  # -> Curves, Points; disabled
scale_28 = Scale(Geometry=brep_brep.Curves, Center=Point(0, 0, 0), Factor=expr("1/2^X", number_slider))  # -> Geometry, Transform
curve_55 = Curve(scale_28.Geometry)
list_length_6 = ListLength(List=curve_55)  # -> expr("X-1", Length)
divide_curve_8 = DivideCurve(Curve=curve_55, Count=1024, Kinks=False)  # -> Points, Tangents, Parameters
multiplication_6 = Multiplication(A=list_length_6, B=Slider(0.411152, range=0..1))
torsion = Torsion(Curve=curve_55, Parameter=divide_curve_8.Parameters)  # -> Point, Torsion
panel_136 = Panel(torsion.Torsion)
list_item_5 = ListItem(List=curve_55, Index=multiplication_6, Wrap=False)
derivatives_2 = Derivatives(Curve=curve_55, Parameter=divide_curve_8.Parameters)  # -> Point, FirstDerivative, SecondDerivative, ThirdDerivative, FourthDerivative, FifthDerivative, SixthDerivative
panel_137 = Panel(curve_55)
quick_graph_11 = QuickGraph(torsion.Torsion, SortOrder=0)
line_sdl_19 = LineSDL(Start=derivatives_2.Point, Direction=derivatives_2.SecondDerivative, Length=expr("-ABS(X)/4", 1))
crv = Curve(scale_25.Geometry)
crv_2 = Curve(rotate_11.Geometry)
scale_29 = Scale(Geometry=crv, Center=Point(0, 0, 0), Factor=expr("2^X", number_slider_2))  # -> Geometry, Transform
scale_30 = Scale(Geometry=crv_2, Center=Point(0, 0, 0), Factor=expr("2^X", number_slider_2))  # -> Geometry, Transform
divide = DivideCurve(Curve=scale_29.Geometry, Number=Slider(845, range=0..1024), Kinks=False)  # -> Points, Tangents, Parameters
yz = YZPlane(Origin=divide.Points)
pcomp = Decompose(Point=divide.Points)  # -> XComponent, YComponent, ZComponent
pcx = CurvePlane(Curve=scale_30.Geometry, Plane=yz)  # -> Points, ParamsC, ParamsP
pcomp_2 = Decompose(Point=flatten(pcx.Points))  # -> XComponent, YComponent, ZComponent
pt = PointXYZ(XComponent=pcomp.XComponent, YComponent=pcomp.YComponent, ZComponent=pcomp_2.ZComponent)
scale_31 = Scale(Geometry=pt, Center=Point(0, 0, 0), Factor=expr("1/2^X", number_slider_2))  # -> Geometry, Transform
interpolate_5 = Interpolate(Vertices=scale_31.Geometry, Degree=3, Periodic=False, KnotStyle=2)  # -> Curve, Length, Domain

list_length_7 = ListLength(List=curve_53)  # -> flatten(Length)
mass_addition = MassAddition(Input=list_length_7)  # -> Result, PartialResults
panel_138 = Panel(mass_addition.Result)
series_10 = Series(Start=1, Step=1, Count=panel_138)  # -> graft(Series)
vector_xyz = VectorXYZ(XComponent=expr("-X", series_10), YComponent=0, ZComponent=0)  # -> Vector, Length

vector_xyz_2 = VectorXYZ(XComponent=expr("-X", series_10), YComponent=1, ZComponent=0)  # -> Vector, Length

vector_xyz_3 = VectorXYZ(XComponent=expr("-X", series_10), YComponent=0.75, ZComponent=0)  # -> Vector, Length

vector_xyz_4 = VectorXYZ(XComponent=expr("-X", series_10), YComponent=0.5, ZComponent=0)  # -> Vector, Length

vector_xyz_5 = VectorXYZ(XComponent=expr("-X", series_10), YComponent=0.25, ZComponent=0)  # -> Vector, Length

vector_xyz_6 = VectorXYZ(XComponent=expr("-X", series_10), YComponent=1.5, ZComponent=0)  # -> Vector, Length

vector_xyz_7 = VectorXYZ(XComponent=expr("-X", series_10), YComponent=1.25, ZComponent=0)  # -> Vector, Length

vector_xyz_8 = VectorXYZ(XComponent=expr("-X", series_10), YComponent=1.75, ZComponent=0)  # -> Vector, Length

vector_xyz_9 = VectorXYZ(XComponent=expr("-X", series_10), YComponent=2, ZComponent=0)  # -> Vector, Length

curve_56 = Curve(graft(curve_53))
divide_curve_9 = DivideCurve(Curve=curve_56, Count=number_11, Kinks=False)  # -> Points, Tangents, Parameters
curvature_3 = Curvature(Curve=curve_56, Parameter=divide_curve_9.Parameters)  # -> Point, Curvature, Curvature_2
deconstruct_arc_3 = DeconstructArc(Arc=curvature_3.Curvature_2)  # -> BasePlane, Radius, Angle
expression_99 = Expression(O=deconstruct_arc_3.Radius, Expression="FORMAT(\"{0:R}\",O)")  # disabled
panel_139 = Panel(expression_99)
quick_graph_12 = QuickGraph(deconstruct_arc_3.Radius, SortOrder=0)
one_over_x_10 = OneOverX(Value=deconstruct_arc_3.Radius)

expression_100 = Expression(O=one_over_x_10, Expression="FORMAT(\"{0:R}\",O)")  # disabled
panel_140 = Panel(expression_100)

quick_graph_13 = QuickGraph(one_over_x_10, SortOrder=0)
multiplication_7 = Multiplication(A=one_over_x_10, B=digit_scroller_15)
line_sdl_20 = LineSDL(Start=divide_curve_6.Points, Direction=Vector(0, 1, 0), Length=multiplication_7)

replace_nulls_2 = ReplaceNulls(Items=one_over_x_10, Replacements=0)  # -> Items, Count
relative_differences_4 = RelativeDifferences(Values=replace_nulls_2.Items)

expression_101 = Expression(O=relative_differences_4, Expression="FORMAT(\"{0:R}\",O)")  # disabled
panel_141 = Panel(expression_101)
quick_graph_14 = QuickGraph(relative_differences_4, SortOrder=0)
multiplication_8 = Multiplication(A=relative_differences_4, B=digit_scroller_14)
line_sdl_21 = LineSDL(Start=divide_curve_6.Points, Direction=Vector(0, 1, 0), Length=multiplication_8)
move_9 = Move(Geometry=line_sdl_21, Motion=vector_xyz_5.Vector)  # -> Geometry, Transform
evaluate_length_38 = EvaluateLength(Curve=move_9.Geometry, Length=1, Normalized=True)  # -> Point, Tangent, Parameter
interpolate_6 = Interpolate(Vertices=evaluate_length_38.Point, Degree=3, Periodic=False, KnotStyle=2)  # -> Curve, Length, Domain

replace_nulls_3 = ReplaceNulls(Items=relative_differences_4, Replacements=0)  # -> Items, Count
relative_differences_5 = RelativeDifferences(Values=replace_nulls_3.Items)
expression_102 = Expression(O=relative_differences_5, Expression="FORMAT(\"{0:R}\",O)")  # disabled
panel_142 = Panel(expression_102)
quick_graph_15 = QuickGraph(relative_differences_5, SortOrder=0)
multiplication_9 = Multiplication(A=relative_differences_5, B=digit_scroller_13)
line_sdl_22 = LineSDL(Start=divide_curve_6.Points, Direction=Vector(0, 1, 0), Length=multiplication_9)
move_10 = Move(Geometry=line_sdl_22, Motion=vector_xyz_4.Vector)  # -> Geometry, Transform
evaluate_length_39 = EvaluateLength(Curve=move_10.Geometry, Length=1, Normalized=True)  # -> Point, Tangent, Parameter
interpolate_7 = Interpolate(Vertices=evaluate_length_39.Point, Degree=3, Periodic=False, KnotStyle=2)  # -> Curve, Length, Domain

replace_nulls_4 = ReplaceNulls(Items=relative_differences_5, Replacements=0)  # -> Items, Count
relative_differences_6 = RelativeDifferences(Values=replace_nulls_4.Items)
expression_103 = Expression(O=relative_differences_6, Expression="FORMAT(\"{0:R}\",O)")  # disabled
panel_143 = Panel(expression_103)
quick_graph_16 = QuickGraph(relative_differences_6, SortOrder=0)
multiplication_10 = Multiplication(A=relative_differences_6, B=digit_scroller_12)
line_sdl_23 = LineSDL(Start=divide_curve_6.Points, Direction=Vector(0, 1, 0), Length=multiplication_10)
move_11 = Move(Geometry=line_sdl_23, Motion=vector_xyz_3.Vector)  # -> Geometry, Transform
evaluate_length_40 = EvaluateLength(Curve=move_11.Geometry, Length=1, Normalized=True)  # -> Point, Tangent, Parameter
interpolate_8 = Interpolate(Vertices=evaluate_length_40.Point, Degree=3, Periodic=False, KnotStyle=2)  # -> Curve, Length, Domain

replace_nulls_5 = ReplaceNulls(Items=relative_differences_6, Replacements=0)  # -> Items, Count
relative_differences_7 = RelativeDifferences(Values=replace_nulls_5.Items)
expression_104 = Expression(O=relative_differences_7, Expression="FORMAT(\"{0:R}\",O)")  # disabled
panel_144 = Panel(expression_104)
quick_graph_17 = QuickGraph(relative_differences_7, SortOrder=0)
multiplication_11 = Multiplication(A=relative_differences_7, B=digit_scroller_11)
line_sdl_24 = LineSDL(Start=divide_curve_6.Points, Direction=Vector(0, 1, 0), Length=multiplication_11)
move_12 = Move(Geometry=line_sdl_24, Motion=vector_xyz_2.Vector)  # -> Geometry, Transform
evaluate_length_41 = EvaluateLength(Curve=move_12.Geometry, Length=1, Normalized=True)  # -> Point, Tangent, Parameter
interpolate_9 = Interpolate(Vertices=evaluate_length_41.Point, Degree=3, Periodic=False, KnotStyle=2)  # -> Curve, Length, Domain

replace_nulls_6 = ReplaceNulls(Items=relative_differences_7, Replacements=0)  # -> Items, Count
relative_differences_8 = RelativeDifferences(Values=replace_nulls_6.Items)
expression_105 = Expression(O=relative_differences_8, Expression="FORMAT(\"{0:R}\",O)")  # disabled
panel_145 = Panel(expression_105)
quick_graph_18 = QuickGraph(relative_differences_8, SortOrder=0)
multiplication_12 = Multiplication(A=relative_differences_8, B=digit_scroller_16)
line_sdl_25 = LineSDL(Start=divide_curve_6.Points, Direction=Vector(0, 1, 0), Length=multiplication_12)
move_13 = Move(Geometry=line_sdl_25, Motion=vector_xyz_7.Vector)  # -> Geometry, Transform
evaluate_length_42 = EvaluateLength(Curve=move_13.Geometry, Length=1, Normalized=True)  # -> Point, Tangent, Parameter
interpolate_10 = Interpolate(Vertices=evaluate_length_42.Point, Degree=3, Periodic=False, KnotStyle=2)  # -> Curve, Length, Domain

replace_nulls_7 = ReplaceNulls(Items=relative_differences_8, Replacements=0)  # -> Items, Count
relative_differences_9 = RelativeDifferences(Values=replace_nulls_7.Items)

expression_106 = Expression(O=relative_differences_9, Expression="FORMAT(\"{0:R}\",O)")  # disabled
panel_146 = Panel(expression_106)
quick_graph_19 = QuickGraph(relative_differences_9, SortOrder=0)
multiplication_13 = Multiplication(A=relative_differences_9, B=digit_scroller_17)
line_sdl_26 = LineSDL(Start=divide_curve_6.Points, Direction=Vector(0, 1, 0), Length=multiplication_13)
move_14 = Move(Geometry=line_sdl_26, Motion=vector_xyz_6.Vector)  # -> Geometry, Transform
evaluate_length_43 = EvaluateLength(Curve=move_14.Geometry, Length=1, Normalized=True)  # -> Point, Tangent, Parameter
interpolate_11 = Interpolate(Vertices=evaluate_length_43.Point, Degree=3, Periodic=False, KnotStyle=2)  # -> Curve, Length, Domain

replace_nulls_8 = ReplaceNulls(Items=relative_differences_9, Replacements=0)  # -> Items, Count
relative_differences_10 = RelativeDifferences(Values=replace_nulls_8.Items)
expression_107 = Expression(O=relative_differences_10, Expression="FORMAT(\"{0:R}\",O)")  # disabled
panel_147 = Panel(expression_107)
quick_graph_20 = QuickGraph(relative_differences_10, SortOrder=0)
multiplication_14 = Multiplication(A=relative_differences_10, B=digit_scroller_18)
line_sdl_27 = LineSDL(Start=divide_curve_6.Points, Direction=Vector(0, 1, 0), Length=multiplication_14)
move_15 = Move(Geometry=line_sdl_27, Motion=vector_xyz_8.Vector)  # -> Geometry, Transform
evaluate_length_44 = EvaluateLength(Curve=move_15.Geometry, Length=1, Normalized=True)  # -> Point, Tangent, Parameter
interpolate_12 = Interpolate(Vertices=evaluate_length_44.Point, Degree=3, Periodic=False, KnotStyle=2)  # -> Curve, Length, Domain

replace_nulls_9 = ReplaceNulls(Items=relative_differences_10, Replacements=0)  # -> Items, Count
relative_differences_11 = RelativeDifferences(Values=replace_nulls_9.Items)
expression_108 = Expression(O=relative_differences_11, Expression="FORMAT(\"{0:R}\",O)")  # disabled
panel_148 = Panel(expression_108)
quick_graph_21 = QuickGraph(relative_differences_11, SortOrder=0)
multiplication_15 = Multiplication(A=relative_differences_11, B=digit_scroller_19)
line_sdl_28 = LineSDL(Start=divide_curve_6.Points, Direction=Vector(0, 1, 0), Length=multiplication_15)  # disabled
move_16 = Move(Geometry=line_sdl_28, Motion=vector_xyz_9.Vector)  # -> Geometry, Transform
evaluate_length_45 = EvaluateLength(Curve=move_16.Geometry, Length=1, Normalized=True)  # -> Point, Tangent, Parameter
interpolate_13 = Interpolate(Vertices=evaluate_length_45.Point, Degree=3, Periodic=False, KnotStyle=2)  # -> Curve, Length, Domain

custom_preview_8 = CustomPreview(Geometry=interpolate_9.Curve, Material=create_material_8)

custom_preview_9 = CustomPreview(Geometry=move_12.Geometry, Material=create_material_9)

custom_preview_10 = CustomPreview(Geometry=interpolate_8.Curve, Material=create_material_10)

custom_preview_11 = CustomPreview(Geometry=move_11.Geometry, Material=create_material_11)

custom_preview_12 = CustomPreview(Geometry=interpolate_7.Curve, Material=create_material_12)

custom_preview_13 = CustomPreview(Geometry=move_10.Geometry, Material=create_material_13)

custom_preview_14 = CustomPreview(Geometry=interpolate_6.Curve, Material=create_material_14)

custom_preview_15 = CustomPreview(Geometry=move_9.Geometry, Material=create_material_15)

custom_preview_16 = CustomPreview(Geometry=interpolate_11.Curve, Material=create_material_18)

custom_preview_17 = CustomPreview(Geometry=move_14.Geometry, Material=create_material_19)

custom_preview_18 = CustomPreview(Geometry=interpolate_10.Curve, Material=create_material_20)

custom_preview_19 = CustomPreview(Geometry=move_13.Geometry, Material=create_material_21)

custom_preview_20 = CustomPreview(Geometry=interpolate_12.Curve, Material=create_material_22)

custom_preview_21 = CustomPreview(Geometry=move_15.Geometry, Material=create_material_23)

custom_preview_22 = CustomPreview(Geometry=interpolate_13.Curve, Material=create_material_24)

custom_preview_23 = CustomPreview(Geometry=move_16.Geometry, Material=create_material_25)

curve_57 = Curve(line_sdl_20)

move_17 = Move(Geometry=curve_57, Motion=vector_xyz.Vector)  # -> Geometry, Transform
evaluate_length_46 = EvaluateLength(Curve=move_17.Geometry, Length=1, Normalized=True)  # -> Point, Tangent, Parameter
interpolate_14 = Interpolate(Vertices=evaluate_length_46.Point, Degree=3, Periodic=False, KnotStyle=2)  # -> Curve, Length, Domain

custom_preview_24 = CustomPreview(Geometry=interpolate_14.Curve, Material=create_material_16)

custom_preview_25 = CustomPreview(Geometry=move_17.Geometry, Material=create_material_17)

curve_58 = Curve(graft(curve_53))
divide_curve_10 = DivideCurve(Curve=curve_58, Count=number_12, Kinks=False)  # -> Points, Tangents, Parameters
curvature_4 = Curvature(Curve=curve_58, Parameter=divide_curve_10.Parameters)  # -> Point, Curvature, Curvature_2
deconstruct_arc_4 = DeconstructArc(Arc=curvature_4.Curvature_2)  # -> BasePlane, Radius, Angle
line_3 = Line(StartPoint=curvature_4.Point, EndPoint=deconstruct_arc_4.BasePlane)
one_over_x_11 = OneOverX(Value=deconstruct_arc_4.Radius)
quick_graph_22 = QuickGraph(one_over_x_11, SortOrder=0)
replace_nulls_10 = ReplaceNulls(Items=one_over_x_11, Replacements=0)  # -> Items, Count
relative_differences_12 = RelativeDifferences(Values=replace_nulls_10.Items)
curvature_graph_2 = CurvatureGraph(Curve=curve_58, Density=1, Scale=digit_scroller_24)  # disabled
custom_preview_26 = CustomPreview(Geometry=curve_58, Material=create_material_28)

expression_109 = Expression(O=relative_differences_12, Expression="FORMAT(\"{0:R}\",O)")  # disabled
panel_149 = Panel(expression_109)
quick_graph_23 = QuickGraph(relative_differences_12, SortOrder=0)

expression_110 = Expression(O=one_over_x_11, Expression="FORMAT(\"{0:R}\",O)")  # disabled
panel_150 = Panel(expression_110)

expression_111 = Expression(O=deconstruct_arc_4.Radius, Expression="FORMAT(\"{0:R}\",O)")  # disabled
panel_151 = Panel(expression_111)

torsion_2 = Torsion(Curve=curve_58, Parameter=divide_curve_10.Parameters)  # -> Point, Torsion; disabled
panel_152 = Panel(torsion_2.Point)

relative_differences_13 = RelativeDifferences(Values=relative_differences_12)

quick_graph_24 = QuickGraph(relative_differences_13, SortOrder=0)
bounds_8 = Bounds(Numbers=relative_differences_13)
remap_numbers_3 = RemapNumbers(Value=relative_differences_13, Source=bounds_8, Target=Domain(-1, 1))  # -> Mapped, Clipped

relative_differences_14 = RelativeDifferences(Values=relative_differences_13)

quick_graph_25 = QuickGraph(relative_differences_14, SortOrder=0)
bounds_9 = Bounds(Numbers=relative_differences_14)
remap_numbers_4 = RemapNumbers(Value=relative_differences_14, Source=bounds_9, Target=Domain(-1, 1))  # -> Mapped, Clipped

relative_differences_15 = RelativeDifferences(Values=relative_differences_14)

quick_graph_26 = QuickGraph(relative_differences_15, SortOrder=0)
bounds_10 = Bounds(Numbers=relative_differences_15)
remap_numbers_5 = RemapNumbers(Value=relative_differences_15, Source=bounds_10, Target=Domain(-1, 1))  # -> Mapped, Clipped

relative_differences_16 = RelativeDifferences(Values=relative_differences_15)

relative_differences_17 = RelativeDifferences(Values=relative_differences_16)

quick_graph_27 = QuickGraph(relative_differences_17, SortOrder=0)
bounds_11 = Bounds(Numbers=relative_differences_17)
remap_numbers_6 = RemapNumbers(Value=relative_differences_17, Source=bounds_11, Target=Domain(-1, 1))  # -> Mapped, Clipped

relative_differences_18 = RelativeDifferences(Values=relative_differences_17)

quick_graph_28 = QuickGraph(relative_differences_18, SortOrder=0)
bounds_12 = Bounds(Numbers=relative_differences_18)
remap_numbers_7 = RemapNumbers(Value=relative_differences_18, Source=bounds_12, Target=Domain(-1, 1))  # -> Mapped, Clipped

relative_differences_19 = RelativeDifferences(Values=relative_differences_18)

quick_graph_29 = QuickGraph(relative_differences_19, SortOrder=0)
bounds_13 = Bounds(Numbers=relative_differences_19)
remap_numbers_8 = RemapNumbers(Value=relative_differences_19, Source=bounds_13, Target=Domain(-1, 1))  # -> Mapped, Clipped

quick_graph_30 = QuickGraph(relative_differences_16, SortOrder=0)
bounds_14 = Bounds(Numbers=relative_differences_16)
remap_numbers_9 = RemapNumbers(Value=relative_differences_16, Source=bounds_14, Target=Domain(-1, 1))  # -> Mapped, Clipped

bounds_15 = Bounds(Numbers=relative_differences_12)
remap_numbers_10 = RemapNumbers(Value=relative_differences_12, Source=bounds_15, Target=Domain(-1, 1))  # -> Mapped, Clipped

bounds_16 = Bounds(Numbers=one_over_x_11)
remap_numbers_11 = RemapNumbers(Value=one_over_x_11, Source=bounds_16, Target=Domain(0, 1))  # -> Mapped, Clipped

length_3 = Length(Curve=curve_58)
multiplication_16 = Multiplication(A=remap_numbers_10.Mapped, B=length_3)
multiplication_17 = Multiplication(A=length_3, B=remap_numbers_11.Mapped)
derivatives_3 = Derivatives(Curve=curve_58, Parameter=divide_curve_10.Parameters)  # -> Point, FirstDerivative, SecondDerivative, ThirdDerivative, FourthDerivative, FifthDerivative, SixthDerivative; disabled
quick_graph_31 = QuickGraph(derivatives_3.SixthDerivative, SortOrder=0)
quick_graph_32 = QuickGraph(derivatives_3.FifthDerivative, SortOrder=0)
quick_graph_33 = QuickGraph(derivatives_3.FourthDerivative, SortOrder=0)
quick_graph_34 = QuickGraph(derivatives_3.ThirdDerivative, SortOrder=0)
quick_graph_35 = QuickGraph(derivatives_3.SecondDerivative, SortOrder=0)
quick_graph_36 = QuickGraph(derivatives_3.FirstDerivative, SortOrder=0)
quick_graph_37 = QuickGraph(derivatives_3.Point, SortOrder=0)

multiplication_18 = Multiplication(A=multiplication_16, B=Slider(0.020588, range=0..1))

multiplication_19 = Multiplication(A=multiplication_17, B=Slider(0.043752, range=0..2))

line_sdl_29 = LineSDL(Start=curvature_4.Point, Direction=line_3, Length=expr("-X", multiplication_19))
evaluate_length_47 = EvaluateLength(Curve=line_sdl_29, Length=1, Normalized=True)  # -> Point, Tangent, Parameter
interpolate_15 = Interpolate(Vertices=evaluate_length_47.Point, Degree=3, Periodic=False, KnotStyle=2)  # -> Curve, Length, Domain
custom_preview_27 = CustomPreview(Geometry=line_sdl_29, Material=create_material_27)
curve_59 = Curve(interpolate_15.Curve)
custom_preview_28 = CustomPreview(Geometry=curve_59, Material=create_material_26)

line_sdl_30 = LineSDL(Start=evaluate_length_47.Point, Direction=line_sdl_29, Length=expr("ABS(X)", multiplication_18))
nurbs_curve_3 = NurbsCurve(Vertices=evaluate_length_47.Point, Degree=3, Periodic=False)  # -> Curve, Length, Domain
custom_preview_29 = CustomPreview(Geometry=line_sdl_30, Material=create_material_44)
curve_60 = Curve(line_sdl_30)
evaluate_length_48 = EvaluateLength(Curve=curve_60, Length=1, Normalized=True)  # -> Point, Tangent, Parameter
interpolate_16 = Interpolate(Vertices=evaluate_length_48.Point, Degree=3, Periodic=False, KnotStyle=2)  # -> Curve, Length, Domain
polyline_2 = PolyLine(Vertices=evaluate_length_48.Point, Closed=False)
explode_2 = Explode(Curve=polyline_2, Recursive=True)  # -> Segments, Vertices
custom_preview_30 = CustomPreview(Geometry=interpolate_16.Curve, Material=create_material_43)
curve_61 = Curve(flatten(explode_2.Segments))
length_4 = Length(Curve=curve_61)
sort_list_2 = SortList(Keys=length_4, ValuesValuesA=curve_61)  # -> Keys, ValuesValuesA
list_item_6 = ListItem(List=sort_list_2.Keys, Index=0, Wrap=False)
dot_display_2 = DotDisplay(Point=evaluate_length_48.Point, Colour=RGB(194, 194, 194), Size=expr("X/2", list_item_6))
line_sdl_31 = LineSDL(Start=evaluate_length_48.Point, Direction=derivatives_3.ThirdDerivative, Length=expr("-X", multiplication_18))
evaluate_length_49 = EvaluateLength(Curve=line_sdl_31, Length=1, Normalized=True)  # -> Point, Tangent, Parameter
interpolate_17 = Interpolate(Vertices=evaluate_length_49.Point, Degree=3, Periodic=False, KnotStyle=2)  # -> Curve, Length, Domain
custom_preview_31 = CustomPreview(Geometry=interpolate_17.Curve, Material=create_material_45)
custom_preview_32 = CustomPreview(Geometry=line_sdl_31, Material=create_material_46)

expression_112 = Expression(O=sort_list_2.Keys, Expression="FORMAT(\"{0:R}\",O)")  # disabled
panel_153 = Panel(expression_112)

multiplication_20 = Multiplication(A=remap_numbers_3.Mapped, B=length_3)
multiplication_21 = Multiplication(A=multiplication_20, B=Slider(0.016713, range=0..1))
line_sdl_32 = LineSDL(Start=evaluate_length_48.Point, Direction=line_sdl_29, Length=expr("ABS(X)", multiplication_21))

evaluate_length_50 = EvaluateLength(Curve=line_sdl_32, Length=1, Normalized=True)  # -> Point, Tangent, Parameter
interpolate_18 = Interpolate(Vertices=evaluate_length_50.Point, Degree=3, Periodic=False, KnotStyle=2)  # -> Curve, Length, Domain
custom_preview_33 = CustomPreview(Geometry=interpolate_18.Curve, Material=create_material_41)
custom_preview_34 = CustomPreview(Geometry=line_sdl_32, Material=create_material_42)

multiplication_22 = Multiplication(A=remap_numbers_4.Mapped, B=length_3)
multiplication_23 = Multiplication(A=multiplication_22, B=Slider(0.533333, range=0..4))
line_sdl_33 = LineSDL(Start=evaluate_length_50.Point, Direction=line_sdl_29, Length=expr("ABS(X)", multiplication_23))

evaluate_length_51 = EvaluateLength(Curve=line_sdl_33, Length=1, Normalized=True)  # -> Point, Tangent, Parameter
interpolate_19 = Interpolate(Vertices=evaluate_length_51.Point, Degree=3, Periodic=False, KnotStyle=2)  # -> Curve, Length, Domain
custom_preview_35 = CustomPreview(Geometry=interpolate_19.Curve, Material=create_material_39)
custom_preview_36 = CustomPreview(Geometry=line_sdl_33, Material=create_material_40)

multiplication_24 = Multiplication(A=remap_numbers_5.Mapped, B=length_3)
multiplication_25 = Multiplication(A=multiplication_24, B=digit_scroller_2)
line_sdl_34 = LineSDL(Start=evaluate_length_51.Point, Direction=line_sdl_29, Length=expr("ABS(X)", multiplication_25))

evaluate_length_52 = EvaluateLength(Curve=line_sdl_34, Length=1, Normalized=True)  # -> Point, Tangent, Parameter
interpolate_20 = Interpolate(Vertices=evaluate_length_52.Point, Degree=3, Periodic=False, KnotStyle=2)  # -> Curve, Length, Domain
custom_preview_37 = CustomPreview(Geometry=interpolate_20.Curve, Material=create_material_37)
custom_preview_38 = CustomPreview(Geometry=line_sdl_34, Material=create_material_38)

multiplication_26 = Multiplication(A=remap_numbers_9.Mapped, B=length_3)
multiplication_27 = Multiplication(A=multiplication_26, B=digit_scroller_3)
line_sdl_35 = LineSDL(Start=evaluate_length_52.Point, Direction=line_sdl_29, Length=expr("ABS(X)", multiplication_27))

evaluate_length_53 = EvaluateLength(Curve=line_sdl_35, Length=1, Normalized=True)  # -> Point, Tangent, Parameter
interpolate_21 = Interpolate(Vertices=evaluate_length_53.Point, Degree=3, Periodic=False, KnotStyle=2)  # -> Curve, Length, Domain
custom_preview_39 = CustomPreview(Geometry=interpolate_21.Curve, Material=create_material_35)
custom_preview_40 = CustomPreview(Geometry=line_sdl_35, Material=create_material_36)

multiplication_28 = Multiplication(A=remap_numbers_6.Mapped, B=length_3)
multiplication_29 = Multiplication(A=multiplication_28, B=Slider(0.1, range=0..1))
line_sdl_36 = LineSDL(Start=evaluate_length_53.Point, Direction=line_sdl_29, Length=expr("ABS(X)", multiplication_29))

evaluate_length_54 = EvaluateLength(Curve=line_sdl_36, Length=1, Normalized=True)  # -> Point, Tangent, Parameter
interpolate_22 = Interpolate(Vertices=evaluate_length_54.Point, Degree=3, Periodic=False, KnotStyle=2)  # -> Curve, Length, Domain
custom_preview_41 = CustomPreview(Geometry=interpolate_22.Curve, Material=create_material_33)
custom_preview_42 = CustomPreview(Geometry=line_sdl_36, Material=create_material_34)

multiplication_30 = Multiplication(A=remap_numbers_7.Mapped, B=length_3)
multiplication_31 = Multiplication(A=multiplication_30, B=digit_scroller_22)
line_sdl_37 = LineSDL(Start=evaluate_length_54.Point, Direction=line_sdl_29, Length=expr("ABS(X)", multiplication_31))

evaluate_length_55 = EvaluateLength(Curve=line_sdl_37, Length=1, Normalized=True)  # -> Point, Tangent, Parameter
interpolate_23 = Interpolate(Vertices=evaluate_length_55.Point, Degree=3, Periodic=False, KnotStyle=2)  # -> Curve, Length, Domain
custom_preview_43 = CustomPreview(Geometry=interpolate_23.Curve, Material=create_material_31)
custom_preview_44 = CustomPreview(Geometry=line_sdl_37, Material=create_material_32)

multiplication_32 = Multiplication(A=remap_numbers_8.Mapped, B=length_3)
multiplication_33 = Multiplication(A=multiplication_32, B=Slider(0.25, range=0..4))
line_sdl_38 = LineSDL(Start=evaluate_length_55.Point, Direction=line_sdl_29, Length=expr("ABS(X)", multiplication_33))  # disabled

evaluate_length_56 = EvaluateLength(Curve=line_sdl_38, Length=1, Normalized=True)  # -> Point, Tangent, Parameter
interpolate_24 = Interpolate(Vertices=evaluate_length_56.Point, Degree=3, Periodic=False, KnotStyle=2)  # -> Curve, Length, Domain
custom_preview_45 = CustomPreview(Geometry=interpolate_24.Curve, Material=create_material_29)
custom_preview_46 = CustomPreview(Geometry=line_sdl_38, Material=create_material_30)

merge_4 = Merge(
    Data1=interpolate_20.Curve,
    Data2=interpolate_14.Curve,
    Data3=interpolate_6.Curve,
    Data4=interpolate_7.Curve,
    Data5=interpolate_8.Curve,
    Data6=interpolate_9.Curve)
bounding_box = BoundingBox(Content=merge_4, Plane=PlaneXY(0, 0, 0), UnionBox=True)  # -> Box, Box_2

panel_154 = Panel("0.0014014999884235925")  # disabled
panel_155 = Panel("""1    16    0.35721403168191375
1    256    0.0014014999884235925
1    4096    """)  # disabled
digit_scroller_34 = DigitScroller(Scroller_Digits=12, Scroller_Prefix="Digit Scroller", Scroller_Radix=1, Scroller_Value=0.00140216731)  # disabled
number_slider_13 = Slider(256, range=0..65536)  # disabled
radians_8 = Radians(Degrees=panel_154)  # disabled

expression_113 = Expression(O=radians_8, Expression="FORMAT(\"{0:0.00000000000000000000}\",O)")  # disabled
panel_156 = Panel(expression_113)  # disabled
curve_62 = Curve(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)  # disabled
number_20 = Number(number_slider_13)  # disabled

number_slider_14 = Slider(1, range=0..1)  # disabled
end_points_8 = EndPoints(Curve=curve_62)  # -> Start, End; disabled
rectangle_2pt_8 = Rectangle2Pt(Plane=PlaneXY(0, 0, 0), PointA=end_points_8.Start, PointB=end_points_8.End, Radius=0)  # -> Rectangle, Length; disabled

series_11 = Series(Start=0, Step=panel_156, Count=number_20)  # disabled
expression_114 = Expression(O=series_11, Expression="FORMAT(\"{0:R}\",O)")  # disabled
panel_157 = Panel(expression_114)  # disabled
bounds_17 = Bounds(Numbers=panel_157)  # disabled
one_over_x_12 = OneOverX(Value=number_20)  # disabled
duplicate_data_10 = DuplicateData(Data=one_over_x_12, Number=number_20, Order=True)  # disabled

curve_graph_mapper_6 = CurveGraphMapper(Curves=curve_62, Rectangle=rectangle_2pt_8.Rectangle, Values=series_11, Flip=False, Snap=False, TextSize=0.015625)  # -> Mapped, GraphCurves, GraphPoints, ValueLines, ValuePoints, MappedLines, MappedPoints, Boundary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; disabled
graphmapper_6 = GraphMapper(Curve=curve_62, Boundary=rectangle_2pt_8.Rectangle, Numbers=series_11, Input=bounds_17, Output=bounds_17, bobo=False)  # disabled
stream_filter_7 = StreamFilter(Gate=number_slider_14, Stream0=curve_graph_mapper_6.Mapped, Stream1=graphmapper_6)  # disabled

turtle_8 = DotNETVBScriptLEGACY(Forward=duplicate_data_10, Left=stream_filter_7)  # -> Output, Points; inputs Forward: list, Left: list; disabled; same code as turtle
point_21 = Point(turtle_8.Points)  # disabled

expression_115 = Expression(O=turtle_8.Points, Expression="FORMAT(\"{0:R}\",O)")  # disabled
panel_158 = Panel(expression_115)  # disabled

interpolate_t_8 = InterpolateT(Vertices=point_21, TangentStart=Vector(0.0625, 0, 0), TangentEnd=Vector(0, 0, 0), KnotStyle=2)  # -> Curve, Length, Domain; disabled
evaluate_length_57 = EvaluateLength(Curve=interpolate_t_8.Curve, Length=1, Normalized=True)  # -> Point, Tangent, Parameter; disabled
line_sdl_39 = LineSDL(Start=evaluate_length_57.Point, Direction=evaluate_length_57.Tangent, Length=1)  # disabled
mirror_16 = Mirror(Geometry=interpolate_t_8.Curve, Plane=line_sdl_39)  # -> Geometry, Transform; disabled
join_curves_21 = JoinCurves(Curves=[interpolate_t_8.Curve, mirror_16.Geometry], Preserve=False)  # disabled
evaluate_length_58 = EvaluateLength(Curve=join_curves_21, Length=1, Normalized=True)  # -> Point, Tangent, Parameter; disabled
rotate_12 = Rotate(Geometry=join_curves_21, Angle=3.141592654, Plane=evaluate_length_58.Point)  # -> Geometry, Transform; disabled
join_curves_22 = JoinCurves(Curves=[join_curves_21, rotate_12.Geometry], Preserve=False)  # disabled
curve_63 = Curve(join_curves_22)  # disabled

evaluate_length_59 = EvaluateLength(Curve=join_curves_22, Length=1, Normalized=True)  # -> Point, Tangent, Parameter; disabled
deconstruct_19 = Deconstruct(Point=evaluate_length_59.Point)  # -> XComponent, YComponent, ZComponent; disabled
expression_116 = Expression(O=deconstruct_19.YComponent, Expression="FORMAT(\"{0:R}\",O)")  # disabled
expression_117 = Expression(O=deconstruct_19.XComponent, Expression="FORMAT(\"{0:R}\",O)")  # disabled
expression_118 = Expression(O=deconstruct_19.ZComponent, Expression="FORMAT(\"{0:R}\",O)")  # disabled
panel_159 = Panel(expression_116)  # disabled
panel_160 = Panel(expression_117)  # disabled
panel_161 = Panel(expression_118)  # disabled
addition_8 = Addition(A=panel_159, B=panel_160)  # disabled
expression_119 = Expression(O=addition_8, Expression="FORMAT(\"{0:R}\",O)")  # disabled
panel_162 = Panel(expression_119)  # disabled
division_15 = Division(A=panel_162, B=2)  # disabled
expression_120 = Expression(O=division_15, Expression="FORMAT(\"{0:R}\",O)")  # disabled
panel_163 = Panel(expression_120)  # disabled
scale_32 = Scale(Geometry=point_21, Center=Point(0, 0, 0), Factor=expr("1/X", panel_163))  # -> Geometry, Transform; disabled
scale_33 = Scale(Geometry=curve_63, Center=Point(0, 0, 0), Factor=expr("1/X", panel_163))  # -> Geometry, Transform; disabled
evaluate_length_60 = EvaluateLength(Curve=scale_33.Geometry, Length=1, Normalized=True)  # -> Point, Tangent, Parameter; disabled
deconstruct_20 = Deconstruct(Point=evaluate_length_60.Point)  # -> XComponent, YComponent, ZComponent; disabled
expression_121 = Expression(O=deconstruct_20.YComponent, Expression="FORMAT(\"{0:R}\",O)")  # disabled
expression_122 = Expression(O=deconstruct_20.XComponent, Expression="FORMAT(\"{0:R}\",O)")  # disabled
expression_123 = Expression(O=deconstruct_20.ZComponent, Expression="FORMAT(\"{0:R}\",O)")  # disabled
panel_164 = Panel(expression_121)  # disabled
panel_165 = Panel(expression_122)  # disabled
panel_166 = Panel(expression_123)  # disabled
division_16 = Division(A=panel_160, B=panel_159)  # disabled
expression_124 = Expression(O=division_16, Expression="FORMAT(\"{0:R}\",O)")  # disabled
panel_167 = Panel(expression_124)  # disabled
curve_64 = Curve(scale_33.Geometry)  # disabled
point_22 = Point(scale_32.Geometry)  # disabled
