# Grasshopper definition XHG.⠀⠀⠀⠀ⵙИNⵙⓄⵙᔓᔕⵙꖴⵙᴥⵙᗩⵙߦⵙᙏⵙⓄⵙᑐᑕⵙ◯ⵙИNⵙⓄⵙꖴⵙ✤ⵙᗩⵙᴥⵙᗱᗴⵙ✤ⵙꖴⵙ◯ⵙᗱᗴⵙᗯⵙᴥⵙᑎⵙᑐᑕⵙ◯ⵙᗝⵙᗱᗴⵙߦⵙᗩⵙᙏⵙ◯ⵙᗱᗴⵙᙁⵙ✤ⵙᴥⵙᑎⵙ✤ⵙ◯ⵙᗱᗴⵙᴥⵙᑎⵙ✤ⵙᗩⵙᗯⵙᴥⵙᑎⵙᑐᑕⵙ⠀⠀⠀⠀◯⠀⠀⠀⠀ⵙ⠀⠀⠀⠀◯⠀⠀⠀⠀ⵙᑐᑕⵙᑎⵙᴥⵙᗯⵙᗩⵙ✤ⵙᑎⵙᴥⵙᗱᗴⵙ◯ⵙ✤ⵙᑎⵙᴥⵙ✤ⵙᙁⵙᗱᗴⵙ◯ⵙᙏⵙᗩⵙߦⵙᗱᗴⵙᗝⵙ◯ⵙᑐᑕⵙᑎⵙᴥⵙᗯⵙᗱᗴⵙ◯ⵙꖴⵙ✤ⵙᗱᗴⵙᴥⵙᗩⵙ✤ⵙꖴⵙⓄⵙИNⵙ◯ⵙᑐᑕⵙⓄⵙᙏⵙߦⵙᗩⵙᴥⵙꖴⵙᔓᔕⵙⓄⵙИNⵙ⠀⠀⠀⠀.GHX (Grasshopper 1.0.7)
# plug-ins: Pufferfish, Heteroptera

panel = Panel("0.0000710748925500000001421")
panel_2 = Panel("0.0013733120705119695")

digit_scroller = DigitScroller(Scroller_Digits=12, Scroller_Prefix=" ", Scroller_Radix=6, Scroller_Value=0.3)

digit_scroller_2 = DigitScroller(Scroller_Digits=12, Scroller_Prefix=" ", Scroller_Radix=6, Scroller_Value=0.1)

digit_scroller_3 = DigitScroller(Scroller_Digits=12, Scroller_Prefix=" ", Scroller_Radix=3, Scroller_Value=0.25)

digit_scroller_4 = DigitScroller(Scroller_Digits=12, Scroller_Prefix="Digit Scroller", Scroller_Radix=11, Scroller_Value=3000)

curve = Curve(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)
panel_6 = Panel("0.00137956207")
panel_7 = Panel("""0.00032220000
0.00000220000""")
digit_scroller_5 = DigitScroller(Scroller_Digits=12, Scroller_Prefix="Digit Scroller", Scroller_Radix=1, Scroller_Value=7.7777e-05)
curve_2 = Curve(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)
digit_scroller_6 = DigitScroller(Scroller_Digits=12, Scroller_Prefix="Digit Scroller", Scroller_Radix=1, Scroller_Value=7.7777e-05)

digit_scroller_7 = DigitScroller(Scroller_Digits=12, Scroller_Prefix="Digit Scroller", Scroller_Radix=5, Scroller_Value=20817.02838)

digit_scroller_8 = DigitScroller(Scroller_Digits=12, Scroller_Prefix="Digit Scroller", Scroller_Radix=4, Scroller_Value=2233.523438)

digit_scroller_9 = DigitScroller(Scroller_Digits=12, Scroller_Prefix="Digit Scroller", Scroller_Radix=4, Scroller_Value=281.0810667)
line_sdl = LineSDL(Start=Point(-2.121093912, 1.99985794, 0), Direction=Vector(0.0625, 0.0625, 0), Length=1)

digit_scroller_10 = DigitScroller(Scroller_Digits=12, Scroller_Prefix="Digit Scroller", Scroller_Radix=3, Scroller_Value=0.0689)
line_sdl_2 = LineSDL(Start=Point(0, 0, 0), Direction=Vector(1, 0, 0), Length=1)

digit_scroller_11 = DigitScroller(Scroller_Digits=12, Scroller_Prefix="Digit Scroller", Scroller_Radix=6, Scroller_Value=383463.9766)

digit_scroller_12 = DigitScroller(Scroller_Digits=12, Scroller_Prefix="Digit Scroller", Scroller_Radix=3, Scroller_Value=4.392015)

digit_scroller_13 = DigitScroller(Scroller_Digits=12, Scroller_Prefix="Digit Scroller", Scroller_Radix=5, Scroller_Value=56336.19681)

digit_scroller_14 = DigitScroller(Scroller_Digits=12, Scroller_Prefix="Digit Scroller", Scroller_Radix=6, Scroller_Value=271915.0063)

digit_scroller_15 = DigitScroller(Scroller_Digits=12, Scroller_Prefix="Digit Scroller", Scroller_Radix=7, Scroller_Value=2183007.899)

create_material = CreateMaterial(Diffuse=RGB(191, 191, 191), Specular=RGB(0, 255, 255), Emission=RGB(0, 0, 0), Transparency=0.5, Shine=100)

create_material_2 = CreateMaterial(Diffuse=RGB(217, 217, 217), Specular=RGB(0, 255, 255), Emission=RGB(0, 0, 0), Transparency=0.5, Shine=100)

create_material_3 = CreateMaterial(Diffuse=RGB(199, 199, 199), Specular=RGB(0, 255, 255), Emission=RGB(0, 0, 0), Transparency=0.5, Shine=100)

create_material_4 = CreateMaterial(Diffuse=RGB(224, 224, 224), Specular=RGB(0, 255, 255), Emission=RGB(0, 0, 0), Transparency=0.5, Shine=100)

create_material_5 = CreateMaterial(Diffuse=RGB(207, 207, 207), Specular=RGB(0, 255, 255), Emission=RGB(0, 0, 0), Transparency=0.5, Shine=100)

create_material_6 = CreateMaterial(Diffuse=RGB(232, 232, 232), Specular=RGB(0, 255, 255), Emission=RGB(0, 0, 0), Transparency=0.5, Shine=100)

create_material_7 = CreateMaterial(Diffuse=RGB(214, 214, 214), Specular=RGB(0, 255, 255), Emission=RGB(0, 0, 0), Transparency=0.5, Shine=100)

create_material_8 = CreateMaterial(Diffuse=RGB(240, 240, 240), Specular=RGB(0, 255, 255), Emission=RGB(0, 0, 0), Transparency=0.5, Shine=100)

create_material_9 = CreateMaterial(Diffuse=RGB(222, 222, 222), Specular=RGB(0, 255, 255), Emission=RGB(0, 0, 0), Transparency=0.5, Shine=100)

create_material_10 = CreateMaterial(Diffuse=RGB(247, 247, 247), Specular=RGB(0, 255, 255), Emission=RGB(0, 0, 0), Transparency=0.5, Shine=100)

create_material_11 = CreateMaterial(Diffuse=RGB(161, 161, 161), Specular=RGB(0, 255, 255), Emission=RGB(0, 0, 0), Transparency=0.5, Shine=100)

create_material_12 = CreateMaterial(Diffuse=RGB(186, 186, 186), Specular=RGB(0, 255, 255), Emission=RGB(0, 0, 0), Transparency=0.5, Shine=100)

create_material_13 = CreateMaterial(Diffuse=RGB(168, 168, 168), Specular=RGB(0, 255, 255), Emission=RGB(0, 0, 0), Transparency=0.5, Shine=100)

create_material_14 = CreateMaterial(Diffuse=RGB(194, 194, 194), Specular=RGB(0, 255, 255), Emission=RGB(0, 0, 0), Transparency=0.5, Shine=100)

create_material_15 = CreateMaterial(Diffuse=RGB(184, 184, 184), Specular=RGB(0, 255, 255), Emission=RGB(0, 0, 0), Transparency=0.5, Shine=100)

create_material_16 = CreateMaterial(Diffuse=RGB(209, 209, 209), Specular=RGB(0, 255, 255), Emission=RGB(0, 0, 0), Transparency=0.5, Shine=100)

create_material_17 = CreateMaterial(Diffuse=RGB(176, 176, 176), Specular=RGB(0, 255, 255), Emission=RGB(0, 0, 0), Transparency=0.5, Shine=100)

create_material_18 = CreateMaterial(Diffuse=RGB(201, 201, 201), Specular=RGB(0, 255, 255), Emission=RGB(0, 0, 0), Transparency=0.5, Shine=100)

panel_10 = Panel("""0    256    0.0013733120705119695
0    4096    0.0000053644183496292""")
panel_11 = Panel("0.0013733120705119695*4*4")

digit_scroller_16 = DigitScroller(Scroller_Digits=12, Scroller_Prefix="Digit Scroller", Scroller_Radix=1, Scroller_Value=7.49e-08)
radians = Radians(Degrees="0.0013733120705119695")

digit_scroller_17 = DigitScroller(Scroller_Digits=12, Scroller_Prefix=" ", Scroller_Radix=7, Scroller_Value=16)

number = Number(Slider(256, range=0..65536))

series = Series(Start=0, Step=radians, Count=number)
expression = Expression(X=number, Expression="1/X")
duplicate_data = DuplicateData(Data=expression, Number=number, Order=True)
turtle = DotNETVBScriptLEGACY(Forward=duplicate_data, Left=series)  # -> Output, Points; inputs Forward: list, Left: list
# ---------- turtle: VB ----------
    Dim i As Integer
    Dim dir As New On3dVector(1, 0, 0)    
    Dim pos As New On3dVector(0, 0, 0) 
    Dim axis As New On3dVector(0, 0, 1)
    Dim pnts As New List(Of On3dVector)

    pnts.Add(pos)
    
    For i = 0 To Forward.Count() - 1
      Dim P As New On3dVector
      dir.Rotate(Left(i), axis)      
      P = dir * Forward(i) + pnts(i)
      pnts.Add(P)
    Next
    
    Points = pnts
# ---------- end turtle ----------
point = Point(turtle.Points)

scale = Scale(Geometry=point, Center=Point(0, 0, 0), Factor=expr("2^X", digit_scroller_17))  # -> Geometry, Transform

interpolate_t = InterpolateT(Vertices=scale.Geometry, TangentStart=Vector(0.0625, 0, 0), TangentEnd=Vector(0, 0, 0), KnotStyle=2)  # -> Curve, Length, Domain
evaluate_length = EvaluateLength(Curve=interpolate_t.Curve, Length=1, Normalized=True)  # -> Point, Tangent, Parameter
line_sdl_3 = LineSDL(Start=evaluate_length.Point, Direction=evaluate_length.Tangent, Length=1)
mirror = Mirror(Geometry=interpolate_t.Curve, Plane=line_sdl_3)  # -> Geometry, Transform
join_curves = JoinCurves(Curves=[interpolate_t.Curve, mirror.Geometry], Preserve=False)
evaluate_length_2 = EvaluateLength(Curve=join_curves, Length=1, Normalized=True)  # -> Point, Tangent, Parameter
rotate = Rotate(Geometry=join_curves, Angle=3.141592654, Plane=evaluate_length_2.Point)  # -> Geometry, Transform
join_curves_2 = JoinCurves(Curves=[join_curves, rotate.Geometry], Preserve=False)
curve_3 = Curve(join_curves_2)

expression_2 = Expression(O=turtle.Points, Expression="FORMAT(\"{0:R}\",O)")
panel_12 = Panel(expression_2)
expression_3 = Expression(O=series, Expression="FORMAT(\"{0:R}\",O)")
panel_13 = Panel(expression_3)
evaluate_length_3 = EvaluateLength(Curve=join_curves_2, Length=1, Normalized=True)  # -> Point, Tangent, Parameter
deconstruct = Deconstruct(Point=evaluate_length_3.Point)  # -> XComponent, YComponent, ZComponent
expression_4 = Expression(O=deconstruct.YComponent, Expression="FORMAT(\"{0:R}\",O)")
expression_5 = Expression(O=deconstruct.XComponent, Expression="FORMAT(\"{0:R}\",O)")
expression_6 = Expression(O=deconstruct.ZComponent, Expression="FORMAT(\"{0:R}\",O)")
panel_14 = Panel(expression_4)
panel_15 = Panel(expression_5)
panel_16 = Panel(expression_6)
addition = Addition(A=panel_14, B=panel_15)
expression_7 = Expression(O=addition, Expression="FORMAT(\"{0:R}\",O)")
panel_17 = Panel(expression_7)
division = Division(A=panel_17, B=2)
expression_8 = Expression(O=division, Expression="FORMAT(\"{0:R}\",O)")
panel_18 = Panel(expression_8)
scale_2 = Scale(Geometry=curve_3, Center=Point(0, 0, 0), Factor=expr("1/X", panel_18))  # -> Geometry, Transform
evaluate_length_4 = EvaluateLength(Curve=scale_2.Geometry, Length=1, Normalized=True)  # -> Point, Tangent, Parameter
deconstruct_2 = Deconstruct(Point=evaluate_length_4.Point)  # -> XComponent, YComponent, ZComponent
expression_9 = Expression(O=deconstruct_2.YComponent, Expression="FORMAT(\"{0:R}\",O)")
expression_10 = Expression(O=deconstruct_2.XComponent, Expression="FORMAT(\"{0:R}\",O)")
expression_11 = Expression(O=deconstruct_2.ZComponent, Expression="FORMAT(\"{0:R}\",O)")
panel_19 = Panel(expression_9)
panel_20 = Panel(expression_10)
panel_21 = Panel(expression_11)
division_2 = Division(A=panel_15, B=panel_14)
expression_12 = Expression(O=division_2, Expression="FORMAT(\"{0:R}\",O)")
panel_22 = Panel(expression_12)
curve_4 = Curve(scale_2.Geometry)

number_2 = Number(number)
number_3 = Number(expr("X*4", number_2))

curve_5 = Curve(curve_4)  # disabled
end_points = EndPoints(Curve=curve_5)  # -> Start, End; disabled
rectangle_2pt = Rectangle2Pt(Plane=PlaneXY(0, 0, 0), PointA=end_points.Start, PointB=end_points.End, Radius=0)  # -> Rectangle, Length; disabled
deconstuct_rectangle = DeconstuctRectangle(Rectangle=rectangle_2pt.Rectangle)  # -> BasePlane, XInterval, YInterval; disabled
deconstruct_domain = DeconstructDomain(Domain=deconstuct_rectangle.YInterval)  # -> Start, End; disabled
deconstruct_domain_2 = DeconstructDomain(Domain=deconstuct_rectangle.XInterval)  # -> Start, End; disabled
scale_nu = ScaleNU(
    Geometry=curve_4,
    Plane=PlaneXY(0, 0, 0),
    ScaleX=expr("1/X", deconstruct_domain_2.End),
    ScaleY=expr("1/X", deconstruct_domain.End),
    ScaleZ=1)  # -> Geometry, Transform; disabled
curve_6 = Curve(scale_nu.Geometry)  # disabled

number_4 = Number(number_3)

divide_curve = DivideCurve(Curve=line_sdl_2, Count=number_4, Kinks=False)  # -> Points, Tangents, Parameters

digit_scroller_18 = DigitScroller(Scroller_Digits=12, Scroller_Prefix=" ", Scroller_Radix=7, Scroller_Value=16)

digit_scroller_19 = DigitScroller(Scroller_Digits=12, Scroller_Prefix="Digit Scroller", Scroller_Radix=1, Scroller_Value=7.49e-08)
digit_scroller_20 = DigitScroller(Scroller_Digits=12, Scroller_Prefix="Digit Scroller", Scroller_Radix=1, Scroller_Value=3.31207e-06)
radians_2 = Radians(Degrees=digit_scroller_20)

number_5 = Number(Slider(256, range=0..65536))

series_2 = Series(Start=0, Step=radians_2, Count=number_5)
expression_13 = Expression(X=number_5, Expression="1/X")
duplicate_data_2 = DuplicateData(Data=expression_13, Number=number_5, Order=True)
turtle_2 = DotNETVBScriptLEGACY(Forward=duplicate_data_2, Left=series_2)  # -> Output, Points; inputs Forward: list, Left: list; same code as turtle
point_2 = Point(turtle_2.Points)

scale_3 = Scale(Geometry=point_2, Center=Point(0, 0, 0), Factor=expr("2^X", digit_scroller_18))  # -> Geometry, Transform

interpolate_t_2 = InterpolateT(Vertices=scale_3.Geometry, TangentStart=Vector(0.0625, 0, 0), TangentEnd=Vector(0, 0, 0), KnotStyle=2)  # -> Curve, Length, Domain
evaluate_length_5 = EvaluateLength(Curve=interpolate_t_2.Curve, Length=1, Normalized=True)  # -> Point, Tangent, Parameter
line_sdl_4 = LineSDL(Start=evaluate_length_5.Point, Direction=evaluate_length_5.Tangent, Length=1)
mirror_2 = Mirror(Geometry=interpolate_t_2.Curve, Plane=line_sdl_4)  # -> Geometry, Transform
join_curves_3 = JoinCurves(Curves=[interpolate_t_2.Curve, mirror_2.Geometry], Preserve=False)
evaluate_length_6 = EvaluateLength(Curve=join_curves_3, Length=1, Normalized=True)  # -> Point, Tangent, Parameter
rotate_2 = Rotate(Geometry=join_curves_3, Angle=3.141592654, Plane=evaluate_length_6.Point)  # -> Geometry, Transform
join_curves_4 = JoinCurves(Curves=[join_curves_3, rotate_2.Geometry], Preserve=False)
curve_7 = Curve(join_curves_4)

expression_14 = Expression(O=turtle_2.Points, Expression="FORMAT(\"{0:R}\",O)")
panel_26 = Panel(expression_14)
expression_15 = Expression(O=series_2, Expression="FORMAT(\"{0:R}\",O)")
panel_27 = Panel(expression_15)
evaluate_length_7 = EvaluateLength(Curve=join_curves_4, Length=1, Normalized=True)  # -> Point, Tangent, Parameter
deconstruct_3 = Deconstruct(Point=evaluate_length_7.Point)  # -> XComponent, YComponent, ZComponent
expression_16 = Expression(O=deconstruct_3.YComponent, Expression="FORMAT(\"{0:R}\",O)")
expression_17 = Expression(O=deconstruct_3.XComponent, Expression="FORMAT(\"{0:R}\",O)")
expression_18 = Expression(O=deconstruct_3.ZComponent, Expression="FORMAT(\"{0:R}\",O)")
panel_28 = Panel(expression_16)
panel_29 = Panel(expression_17)
panel_30 = Panel(expression_18)
addition_2 = Addition(A=panel_28, B=panel_29)
expression_19 = Expression(O=addition_2, Expression="FORMAT(\"{0:R}\",O)")
panel_31 = Panel(expression_19)
division_3 = Division(A=panel_31, B=2)
expression_20 = Expression(O=division_3, Expression="FORMAT(\"{0:R}\",O)")
panel_32 = Panel(expression_20)
scale_4 = Scale(Geometry=curve_7, Center=Point(0, 0, 0), Factor=expr("1/X", panel_32))  # -> Geometry, Transform
evaluate_length_8 = EvaluateLength(Curve=scale_4.Geometry, Length=1, Normalized=True)  # -> Point, Tangent, Parameter
deconstruct_4 = Deconstruct(Point=evaluate_length_8.Point)  # -> XComponent, YComponent, ZComponent
expression_21 = Expression(O=deconstruct_4.YComponent, Expression="FORMAT(\"{0:R}\",O)")
expression_22 = Expression(O=deconstruct_4.XComponent, Expression="FORMAT(\"{0:R}\",O)")
expression_23 = Expression(O=deconstruct_4.ZComponent, Expression="FORMAT(\"{0:R}\",O)")
panel_33 = Panel(expression_21)
panel_34 = Panel(expression_22)
panel_35 = Panel(expression_23)
division_4 = Division(A=panel_29, B=panel_28)
expression_24 = Expression(O=division_4, Expression="FORMAT(\"{0:R}\",O)")
panel_36 = Panel(expression_24)
curve_8 = Curve(scale_4.Geometry)

move = Move(Geometry=curve_8, Motion=Vector(0, 2, 0))  # -> Geometry, Transform
number_6 = Number(number_5)
curve_9 = Curve(move.Geometry)

curve_10 = Curve(curve_8)
end_points_2 = EndPoints(Curve=curve_10)  # -> Start, End
rectangle_2pt_2 = Rectangle2Pt(Plane=PlaneXY(0, 0, 0), PointA=end_points_2.Start, PointB=end_points_2.End, Radius=0)  # -> Rectangle, Length
deconstuct_rectangle_2 = DeconstuctRectangle(Rectangle=rectangle_2pt_2.Rectangle)  # -> BasePlane, XInterval, YInterval
deconstruct_domain_3 = DeconstructDomain(Domain=deconstuct_rectangle_2.YInterval)  # -> Start, End
deconstruct_domain_4 = DeconstructDomain(Domain=deconstuct_rectangle_2.XInterval)  # -> Start, End
scale_nu_2 = ScaleNU(
    Geometry=curve_8,
    Plane=PlaneXY(0, 0, 0),
    ScaleX=expr("1/X", deconstruct_domain_4.End),
    ScaleY=expr("1/X", deconstruct_domain_3.End),
    ScaleZ=1)  # -> Geometry, Transform
curve_11 = Curve(scale_nu_2.Geometry)

move_2 = Move(Geometry=curve_11, Motion=Vector(0, 4, 0))  # -> Geometry, Transform
curve_12 = Curve(move_2.Geometry)

digit_scroller_21 = DigitScroller(Scroller_Digits=12, Scroller_Prefix=" ", Scroller_Radix=2, Scroller_Value=30.9312132)
curve_13 = Curve(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)
curve_14 = Curve(curve_8)
scale_5 = Scale(Geometry=curve_14, Center=Point(0, 0, 0), Factor=expr("2^X", "16.93121320041889709"))  # -> Geometry, Transform
curve_15 = Curve(scale_5.Geometry)

digit_scroller_22 = DigitScroller(Scroller_Digits=12, Scroller_Prefix=" ", Scroller_Radix=2, Scroller_Value=30.9312132)
curve_16 = Curve(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)
curve_17 = Curve(curve_11)
scale_6 = Scale(Geometry=curve_17, Center=Point(0, 0, 0), Factor=expr("2^X", "16.93121320041889709"))  # -> Geometry, Transform
curve_18 = Curve(scale_6.Geometry)

digit_scroller_23 = DigitScroller(Scroller_Digits=12, Scroller_Prefix=" ", Scroller_Radix=8, Scroller_Value=12000)

digit_scroller_24 = DigitScroller(Scroller_Digits=12, Scroller_Prefix=" ", Scroller_Radix=5, Scroller_Value=2)

digit_scroller_25 = DigitScroller(Scroller_Digits=12, Scroller_Prefix=" ", Scroller_Radix=11, Scroller_Value=256)
digit_scroller_26 = DigitScroller(Scroller_Digits=12, Scroller_Prefix=" ", Scroller_Radix=11, Scroller_Value=87)
create_material_19 = CreateMaterial(Diffuse=RGB(222, 222, 222), Specular=RGB(0, 255, 255), Emission=RGB(0, 0, 0), Transparency=0.5, Shine=100)
create_material_20 = CreateMaterial(Diffuse=RGB(247, 247, 247), Specular=RGB(0, 255, 255), Emission=RGB(0, 0, 0), Transparency=0.5, Shine=100)
create_material_21 = CreateMaterial(Diffuse=RGB(176, 176, 176), Specular=RGB(0, 255, 255), Emission=RGB(0, 0, 0), Transparency=0.5, Shine=100)
number_7 = Number(number_3)
number_8 = Number(number_7)

digit_scroller_27 = DigitScroller(Scroller_Digits=12, Scroller_Prefix=" ", Scroller_Radix=2, Scroller_Value=0.04375)

digit_scroller_28 = DigitScroller(Scroller_Digits=12, Scroller_Prefix=" ", Scroller_Radix=1, Scroller_Value=0.056352)

create_material_22 = CreateMaterial(Diffuse=RGB(207, 207, 207), Specular=RGB(0, 255, 255), Emission=RGB(0, 0, 0), Transparency=0.5, Shine=100)
create_material_23 = CreateMaterial(Diffuse=RGB(232, 232, 232), Specular=RGB(0, 255, 255), Emission=RGB(0, 0, 0), Transparency=0.5, Shine=100)
create_material_24 = CreateMaterial(Diffuse=RGB(214, 214, 214), Specular=RGB(0, 255, 255), Emission=RGB(0, 0, 0), Transparency=0.5, Shine=100)
create_material_25 = CreateMaterial(Diffuse=RGB(240, 240, 240), Specular=RGB(0, 255, 255), Emission=RGB(0, 0, 0), Transparency=0.5, Shine=100)

create_material_26 = CreateMaterial(Diffuse=RGB(161, 161, 161), Specular=RGB(0, 255, 255), Emission=RGB(0, 0, 0), Transparency=0.5, Shine=100)
create_material_27 = CreateMaterial(Diffuse=RGB(186, 186, 186), Specular=RGB(0, 255, 255), Emission=RGB(0, 0, 0), Transparency=0.5, Shine=100)

create_material_28 = CreateMaterial(Diffuse=RGB(168, 168, 168), Specular=RGB(0, 255, 255), Emission=RGB(0, 0, 0), Transparency=0.5, Shine=100)
create_material_29 = CreateMaterial(Diffuse=RGB(194, 194, 194), Specular=RGB(0, 255, 255), Emission=RGB(0, 0, 0), Transparency=0.5, Shine=100)

create_material_30 = CreateMaterial(Diffuse=RGB(176, 176, 176), Specular=RGB(0, 255, 255), Emission=RGB(0, 0, 0), Transparency=0.5, Shine=100)
create_material_31 = CreateMaterial(Diffuse=RGB(201, 201, 201), Specular=RGB(0, 255, 255), Emission=RGB(0, 0, 0), Transparency=0.5, Shine=100)

create_material_32 = CreateMaterial(Diffuse=RGB(184, 184, 184), Specular=RGB(0, 255, 255), Emission=RGB(0, 0, 0), Transparency=0.5, Shine=100)
create_material_33 = CreateMaterial(Diffuse=RGB(209, 209, 209), Specular=RGB(0, 255, 255), Emission=RGB(0, 0, 0), Transparency=0.5, Shine=100)

create_material_34 = CreateMaterial(Diffuse=RGB(191, 191, 191), Specular=RGB(0, 255, 255), Emission=RGB(0, 0, 0), Transparency=0.5, Shine=100)
create_material_35 = CreateMaterial(Diffuse=RGB(217, 217, 217), Specular=RGB(0, 255, 255), Emission=RGB(0, 0, 0), Transparency=0.5, Shine=100)

create_material_36 = CreateMaterial(Diffuse=RGB(199, 199, 199), Specular=RGB(0, 255, 255), Emission=RGB(0, 0, 0), Transparency=0.5, Shine=100)
create_material_37 = CreateMaterial(Diffuse=RGB(224, 224, 224), Specular=RGB(0, 255, 255), Emission=RGB(0, 0, 0), Transparency=0.5, Shine=100)

create_material_38 = CreateMaterial(Diffuse=RGB(207, 207, 207), Specular=RGB(0, 255, 255), Emission=RGB(0, 0, 0), Transparency=0.5, Shine=100)
create_material_39 = CreateMaterial(Diffuse=RGB(232, 232, 232), Specular=RGB(0, 255, 255), Emission=RGB(0, 0, 0), Transparency=0.5, Shine=100)

panel_38 = Panel("0.35721403168191375/4/4")
panel_39 = Panel("""1    16    0.35721403168191375
1    256    0.0014014999884235925
1    4096    """)
digit_scroller_29 = DigitScroller(Scroller_Digits=12, Scroller_Prefix="Digit Scroller", Scroller_Radix=1, Scroller_Value=0.00140149998)
number_slider = Slider(256, range=0..65536)
radians_3 = Radians(Degrees="0.00137956207")

expression_25 = Expression(O=radians_3, Expression="FORMAT(\"{0:0.00000000000000000000}\",O)")
panel_40 = Panel(expression_25)
curve_19 = Curve(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)
number_9 = Number(number_5)

digit_scroller_30 = DigitScroller(Scroller_Digits=12, Scroller_Prefix=" ", Scroller_Radix=7, Scroller_Value=16)

end_points_3 = EndPoints(Curve=curve_15)  # -> Start, End
rectangle_2pt_3 = Rectangle2Pt(Plane=PlaneXY(0, 0, 0), PointA=end_points_3.Start, PointB=end_points_3.End, Radius=0)  # -> Rectangle, Length

series_3 = Series(Start=0, Step=panel_40, Count=number_9)
expression_26 = Expression(O=series_3, Expression="FORMAT(\"{0:R}\",O)")  # disabled
panel_41 = Panel(expression_26)
bounds = Bounds(Numbers=series_3)
expression_27 = Expression(X=number_9, Expression="1/X")
duplicate_data_3 = DuplicateData(Data=expression_27, Number=number_9, Order=True)

curve_graph_mapper = CurveGraphMapper(Curves=curve_15, Rectangle=rectangle_2pt_3.Rectangle, Values=series_3, Flip=False, Snap=False, TextSize=0.015625)  # -> Mapped, GraphCurves, GraphPoints, ValueLines, ValuePoints, MappedLines, MappedPoints, Boundary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; disabled
graphmapper = GraphMapper(Curve=curve_15, Boundary=rectangle_2pt_3.Rectangle, Numbers=series_3, Input=bounds, Output=bounds, bobo=False)
stream_filter = StreamFilter(Gate=Slider(1, range=0..1), Stream0=curve_graph_mapper.Mapped, Stream1=graphmapper)

turtle_3 = DotNETVBScriptLEGACY(Forward=duplicate_data_3, Left=stream_filter)  # -> Output, Points; inputs Forward: list, Left: list; same code as turtle

expression_28 = Expression(O=turtle_3.Points, Expression="FORMAT(\"{0:R}\",O)")
panel_42 = Panel(expression_28)

point_3 = Point(turtle_3.Points)
scale_7 = Scale(Geometry=point_3, Center=Point(0, 0, 0), Factor=expr("2^X", digit_scroller_30))  # -> Geometry, Transform

interpolate_t_3 = InterpolateT(Vertices=scale_7.Geometry, TangentStart=Vector(0.0625, 0, 0), TangentEnd=Vector(0, 0, 0), KnotStyle=2)  # -> Curve, Length, Domain
evaluate_length_9 = EvaluateLength(Curve=interpolate_t_3.Curve, Length=1, Normalized=True)  # -> Point, Tangent, Parameter
line_sdl_5 = LineSDL(Start=evaluate_length_9.Point, Direction=evaluate_length_9.Tangent, Length=1)
mirror_3 = Mirror(Geometry=interpolate_t_3.Curve, Plane=line_sdl_5)  # -> Geometry, Transform
join_curves_5 = JoinCurves(Curves=[interpolate_t_3.Curve, mirror_3.Geometry], Preserve=False)
evaluate_length_10 = EvaluateLength(Curve=join_curves_5, Length=1, Normalized=True)  # -> Point, Tangent, Parameter
rotate_3 = Rotate(Geometry=join_curves_5, Angle=3.141592654, Plane=evaluate_length_10.Point)  # -> Geometry, Transform
join_curves_6 = JoinCurves(Curves=[join_curves_5, rotate_3.Geometry], Preserve=False)
curve_20 = Curve(join_curves_6)

evaluate_length_11 = EvaluateLength(Curve=join_curves_6, Length=1, Normalized=True)  # -> Point, Tangent, Parameter
deconstruct_5 = Deconstruct(Point=evaluate_length_11.Point)  # -> XComponent, YComponent, ZComponent
expression_29 = Expression(O=deconstruct_5.YComponent, Expression="FORMAT(\"{0:R}\",O)")
expression_30 = Expression(O=deconstruct_5.XComponent, Expression="FORMAT(\"{0:R}\",O)")
expression_31 = Expression(O=deconstruct_5.ZComponent, Expression="FORMAT(\"{0:R}\",O)")
panel_43 = Panel(expression_29)
panel_44 = Panel(expression_30)
panel_45 = Panel(expression_31)
addition_3 = Addition(A=panel_43, B=panel_44)
expression_32 = Expression(O=addition_3, Expression="FORMAT(\"{0:R}\",O)")
panel_46 = Panel(expression_32)
division_5 = Division(A=panel_46, B=2)
expression_33 = Expression(O=division_5, Expression="FORMAT(\"{0:R}\",O)")
panel_47 = Panel(expression_33)
scale_8 = Scale(Geometry=scale_7.Geometry, Center=Point(0, 0, 0), Factor=expr("1/X", panel_47))  # -> Geometry, Transform
scale_9 = Scale(Geometry=curve_20, Center=Point(0, 0, 0), Factor=expr("1/X", panel_47))  # -> Geometry, Transform
evaluate_length_12 = EvaluateLength(Curve=scale_9.Geometry, Length=1, Normalized=True)  # -> Point, Tangent, Parameter
deconstruct_6 = Deconstruct(Point=evaluate_length_12.Point)  # -> XComponent, YComponent, ZComponent
expression_34 = Expression(O=deconstruct_6.YComponent, Expression="FORMAT(\"{0:R}\",O)")
expression_35 = Expression(O=deconstruct_6.XComponent, Expression="FORMAT(\"{0:R}\",O)")
expression_36 = Expression(O=deconstruct_6.ZComponent, Expression="FORMAT(\"{0:R}\",O)")
panel_48 = Panel(expression_34)
panel_49 = Panel(expression_35)
panel_50 = Panel(expression_36)
division_6 = Division(A=panel_44, B=panel_43)
expression_37 = Expression(O=division_6, Expression="FORMAT(\"{0:R}\",O)")
panel_51 = Panel(expression_37)
curve_21 = Curve(scale_9.Geometry)
point_4 = Point(scale_8.Geometry)

move_3 = Move(Geometry=curve_21, Motion=Vector(2, 2, 0))  # -> Geometry, Transform
mirror_4 = Mirror(Geometry=curve_21, Plane=PlaneYZ(0, 0, 0))  # -> Geometry, Transform
curve_22 = Curve(move_3.Geometry)

curve_23 = Curve(curve_21)  # disabled
end_points_4 = EndPoints(Curve=curve_23)  # -> Start, End; disabled
rectangle_2pt_4 = Rectangle2Pt(Plane=PlaneXY(0, 0, 0), PointA=end_points_4.Start, PointB=end_points_4.End, Radius=0)  # -> Rectangle, Length; disabled
deconstuct_rectangle_3 = DeconstuctRectangle(Rectangle=rectangle_2pt_4.Rectangle)  # -> BasePlane, XInterval, YInterval; disabled
deconstruct_domain_5 = DeconstructDomain(Domain=deconstuct_rectangle_3.YInterval)  # -> Start, End; disabled
deconstruct_domain_6 = DeconstructDomain(Domain=deconstuct_rectangle_3.XInterval)  # -> Start, End; disabled
scale_nu_3 = ScaleNU(
    Geometry=curve_21,
    Plane=PlaneXY(0, 0, 0),
    ScaleX=expr("1/X", deconstruct_domain_6.End),
    ScaleY=expr("1/X", deconstruct_domain_5.End),
    ScaleZ=1)  # -> Geometry, Transform; disabled
curve_24 = Curve(scale_nu_3.Geometry)  # disabled
move_4 = Move(Geometry=curve_24, Motion=Vector(0, 1, 0))  # -> Geometry, Transform; disabled
curve_25 = Curve(move_4.Geometry)  # disabled

digit_scroller_31 = DigitScroller(Scroller_Digits=12, Scroller_Prefix="Digit Scroller", Scroller_Radix=1, Scroller_Value=0.00140149998)
number_slider_2 = Slider(256, range=0..65536)
radians_4 = Radians(Degrees="0.00137956207")

expression_38 = Expression(O=radians_4, Expression="FORMAT(\"{0:0.00000000000000000000}\",O)")
panel_55 = Panel(expression_38)
curve_26 = Curve(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)
number_10 = Number(number_5)

digit_scroller_32 = DigitScroller(Scroller_Digits=12, Scroller_Prefix=" ", Scroller_Radix=7, Scroller_Value=16)

end_points_5 = EndPoints(Curve=curve_18)  # -> Start, End
rectangle_2pt_5 = Rectangle2Pt(Plane=PlaneXY(0, 0, 0), PointA=end_points_5.Start, PointB=end_points_5.End, Radius=0)  # -> Rectangle, Length

series_4 = Series(Start=0, Step=panel_55, Count=number_10)
expression_39 = Expression(O=series_4, Expression="FORMAT(\"{0:R}\",O)")  # disabled
panel_56 = Panel(expression_39)
bounds_2 = Bounds(Numbers=series_4)
expression_40 = Expression(X=number_10, Expression="1/X")
duplicate_data_4 = DuplicateData(Data=expression_40, Number=number_10, Order=True)

curve_graph_mapper_2 = CurveGraphMapper(Curves=curve_18, Rectangle=rectangle_2pt_5.Rectangle, Values=series_4, Flip=False, Snap=False, TextSize=0.015625)  # -> Mapped, GraphCurves, GraphPoints, ValueLines, ValuePoints, MappedLines, MappedPoints, Boundary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; disabled
graphmapper_2 = GraphMapper(Curve=curve_18, Boundary=rectangle_2pt_5.Rectangle, Numbers=series_4, Input=bounds_2, Output=bounds_2, bobo=False)
stream_filter_2 = StreamFilter(Gate=Slider(1, range=0..1), Stream0=curve_graph_mapper_2.Mapped, Stream1=graphmapper_2)

turtle_4 = DotNETVBScriptLEGACY(Forward=duplicate_data_4, Left=stream_filter_2)  # -> Output, Points; inputs Forward: list, Left: list; same code as turtle

expression_41 = Expression(O=turtle_4.Points, Expression="FORMAT(\"{0:R}\",O)")
panel_57 = Panel(expression_41)

point_5 = Point(turtle_4.Points)
scale_10 = Scale(Geometry=point_5, Center=Point(0, 0, 0), Factor=expr("2^X", digit_scroller_32))  # -> Geometry, Transform

interpolate_t_4 = InterpolateT(Vertices=scale_10.Geometry, TangentStart=Vector(0.0625, 0, 0), TangentEnd=Vector(0, 0, 0), KnotStyle=2)  # -> Curve, Length, Domain
evaluate_length_13 = EvaluateLength(Curve=interpolate_t_4.Curve, Length=1, Normalized=True)  # -> Point, Tangent, Parameter
line_sdl_6 = LineSDL(Start=evaluate_length_13.Point, Direction=evaluate_length_13.Tangent, Length=1)
mirror_5 = Mirror(Geometry=interpolate_t_4.Curve, Plane=line_sdl_6)  # -> Geometry, Transform
join_curves_7 = JoinCurves(Curves=[interpolate_t_4.Curve, mirror_5.Geometry], Preserve=False)
evaluate_length_14 = EvaluateLength(Curve=join_curves_7, Length=1, Normalized=True)  # -> Point, Tangent, Parameter
rotate_4 = Rotate(Geometry=join_curves_7, Angle=3.141592654, Plane=evaluate_length_14.Point)  # -> Geometry, Transform
join_curves_8 = JoinCurves(Curves=[join_curves_7, rotate_4.Geometry], Preserve=False)
curve_27 = Curve(join_curves_8)

evaluate_length_15 = EvaluateLength(Curve=join_curves_8, Length=1, Normalized=True)  # -> Point, Tangent, Parameter
deconstruct_7 = Deconstruct(Point=evaluate_length_15.Point)  # -> XComponent, YComponent, ZComponent
expression_42 = Expression(O=deconstruct_7.YComponent, Expression="FORMAT(\"{0:R}\",O)")
expression_43 = Expression(O=deconstruct_7.XComponent, Expression="FORMAT(\"{0:R}\",O)")
expression_44 = Expression(O=deconstruct_7.ZComponent, Expression="FORMAT(\"{0:R}\",O)")
panel_58 = Panel(expression_42)
panel_59 = Panel(expression_43)
panel_60 = Panel(expression_44)
addition_4 = Addition(A=panel_58, B=panel_59)
expression_45 = Expression(O=addition_4, Expression="FORMAT(\"{0:R}\",O)")
panel_61 = Panel(expression_45)
division_7 = Division(A=panel_61, B=2)
expression_46 = Expression(O=division_7, Expression="FORMAT(\"{0:R}\",O)")
panel_62 = Panel(expression_46)
scale_11 = Scale(Geometry=scale_10.Geometry, Center=Point(0, 0, 0), Factor=expr("1/X", panel_62))  # -> Geometry, Transform
scale_12 = Scale(Geometry=curve_27, Center=Point(0, 0, 0), Factor=expr("1/X", panel_62))  # -> Geometry, Transform
evaluate_length_16 = EvaluateLength(Curve=scale_12.Geometry, Length=1, Normalized=True)  # -> Point, Tangent, Parameter
deconstruct_8 = Deconstruct(Point=evaluate_length_16.Point)  # -> XComponent, YComponent, ZComponent
expression_47 = Expression(O=deconstruct_8.YComponent, Expression="FORMAT(\"{0:R}\",O)")
expression_48 = Expression(O=deconstruct_8.XComponent, Expression="FORMAT(\"{0:R}\",O)")
expression_49 = Expression(O=deconstruct_8.ZComponent, Expression="FORMAT(\"{0:R}\",O)")
panel_63 = Panel(expression_47)
panel_64 = Panel(expression_48)
panel_65 = Panel(expression_49)
division_8 = Division(A=panel_59, B=panel_58)
expression_50 = Expression(O=division_8, Expression="FORMAT(\"{0:R}\",O)")
panel_66 = Panel(expression_50)
curve_28 = Curve(scale_12.Geometry)
point_6 = Point(scale_11.Geometry)

move_5 = Move(Geometry=curve_28, Motion=Vector(2, 4, 0))  # -> Geometry, Transform
mirror_6 = Mirror(Geometry=curve_28, Plane=PlaneYZ(0, 0, 0))  # -> Geometry, Transform
curve_29 = Curve(move_5.Geometry)

entwine = Entwine(Branch0X=curve_4, Branch1X=curve_9, Branch2X=curve_12, Branch3X=curve_22, Branch4X=curve_29, FlattenInputs=False)
curve_30 = Curve(entwine)
curve_31 = Curve(graft(curve_30))

curve_32 = Curve(curve_28)  # disabled
end_points_6 = EndPoints(Curve=curve_32)  # -> Start, End; disabled
rectangle_2pt_6 = Rectangle2Pt(Plane=PlaneXY(0, 0, 0), PointA=end_points_6.Start, PointB=end_points_6.End, Radius=0)  # -> Rectangle, Length; disabled
deconstuct_rectangle_4 = DeconstuctRectangle(Rectangle=rectangle_2pt_6.Rectangle)  # -> BasePlane, XInterval, YInterval; disabled
deconstruct_domain_7 = DeconstructDomain(Domain=deconstuct_rectangle_4.YInterval)  # -> Start, End; disabled
deconstruct_domain_8 = DeconstructDomain(Domain=deconstuct_rectangle_4.XInterval)  # -> Start, End; disabled
scale_nu_4 = ScaleNU(
    Geometry=curve_28,
    Plane=PlaneXY(0, 0, 0),
    ScaleX=expr("1/X", deconstruct_domain_8.End),
    ScaleY=expr("1/X", deconstruct_domain_7.End),
    ScaleZ=1)  # -> Geometry, Transform; disabled
curve_33 = Curve(scale_nu_4.Geometry)  # disabled
move_6 = Move(Geometry=curve_33, Motion=Vector(0, 1, 0))  # -> Geometry, Transform; disabled
curve_34 = Curve(move_6.Geometry)  # disabled

curve_35 = Curve(graft(curve_31))  # disabled
divide_curve_2 = DivideCurve(Curve=curve_35, Count=number_4, Kinks=False)  # -> Points, Tangents, Parameters
curvature = Curvature(Curve=curve_35, Parameter=divide_curve_2.Parameters)  # -> Point, Curvature, Curvature_2
deconstruct_arc = DeconstructArc(Arc=curvature.Curvature_2)  # -> BasePlane, Radius, Angle
expression_51 = Expression(O=deconstruct_arc.Radius, Expression="FORMAT(\"{0:R}\",O)")  # disabled
panel_68 = Panel(expression_51)
quick_graph = QuickGraph(deconstruct_arc.Radius, SortOrder=0)
one_over_x = OneOverX(Value=deconstruct_arc.Radius)

expression_52 = Expression(O=one_over_x, Expression="FORMAT(\"{0:R}\",O)")  # disabled
panel_69 = Panel(expression_52)

quick_graph_2 = QuickGraph(one_over_x, SortOrder=0)
multiplication = Multiplication(A=one_over_x, B=digit_scroller_10)
line_sdl_7 = LineSDL(Start=divide_curve.Points, Direction=Vector(0, 1, 0), Length=multiplication)

replace_nulls = ReplaceNulls(Items=one_over_x, Replacements=0)  # -> Items, Count
relative_differences = RelativeDifferences(Values=replace_nulls.Items)

curve_36 = Curve(line_sdl_7)

list_length = ListLength(List=curve_35)  # -> flatten(Length)
mass_addition = MassAddition(Input=list_length)  # -> Result, PartialResults
panel_70 = Panel(mass_addition.Result)
series_5 = Series(Start=1, Step=1, Count=panel_70)  # -> graft(Series)
vector_xyz = VectorXYZ(XComponent=expr("-X", series_5), YComponent=0, ZComponent=0)  # -> Vector, Length
move_7 = Move(Geometry=curve_36, Motion=vector_xyz.Vector)  # -> Geometry, Transform
evaluate_length_17 = EvaluateLength(Curve=move_7.Geometry, Length=1, Normalized=True)  # -> Point, Tangent, Parameter
interpolate = Interpolate(Vertices=evaluate_length_17.Point, Degree=1, Periodic=False, KnotStyle=2)  # -> Curve, Length, Domain

expression_53 = Expression(O=relative_differences, Expression="FORMAT(\"{0:R}\",O)")  # disabled
panel_71 = Panel(expression_53)
vector_xyz_2 = VectorXYZ(XComponent=expr("-X", series_5), YComponent=1, ZComponent=0)  # -> Vector, Length
quick_graph_3 = QuickGraph(relative_differences, SortOrder=0)
multiplication_2 = Multiplication(A=relative_differences, B=digit_scroller_12)
line_sdl_8 = LineSDL(Start=divide_curve.Points, Direction=Vector(0, 1, 0), Length=multiplication_2)
move_8 = Move(Geometry=line_sdl_8, Motion=vector_xyz_2.Vector)  # -> Geometry, Transform
evaluate_length_18 = EvaluateLength(Curve=move_8.Geometry, Length=1, Normalized=True)  # -> Point, Tangent, Parameter
interpolate_2 = Interpolate(Vertices=evaluate_length_18.Point, Degree=1, Periodic=False, KnotStyle=2)  # -> Curve, Length, Domain

vector_xyz_3 = VectorXYZ(XComponent=expr("-X", series_5), YComponent=2, ZComponent=0)  # -> Vector, Length
replace_nulls_2 = ReplaceNulls(Items=relative_differences, Replacements=0)  # -> Items, Count
relative_differences_2 = RelativeDifferences(Values=replace_nulls_2.Items)
expression_54 = Expression(O=relative_differences_2, Expression="FORMAT(\"{0:R}\",O)")  # disabled
panel_72 = Panel(expression_54)
quick_graph_4 = QuickGraph(relative_differences_2, SortOrder=0)
multiplication_3 = Multiplication(A=relative_differences_2, B=digit_scroller_9)
line_sdl_9 = LineSDL(Start=divide_curve.Points, Direction=Vector(0, 1, 0), Length=multiplication_3)
move_9 = Move(Geometry=line_sdl_9, Motion=vector_xyz_3.Vector)  # -> Geometry, Transform
evaluate_length_19 = EvaluateLength(Curve=move_9.Geometry, Length=1, Normalized=True)  # -> Point, Tangent, Parameter
interpolate_3 = Interpolate(Vertices=evaluate_length_19.Point, Degree=1, Periodic=False, KnotStyle=2)  # -> Curve, Length, Domain

vector_xyz_4 = VectorXYZ(XComponent=expr("-X", series_5), YComponent=3, ZComponent=0)  # -> Vector, Length
replace_nulls_3 = ReplaceNulls(Items=relative_differences_2, Replacements=0)  # -> Items, Count
relative_differences_3 = RelativeDifferences(Values=replace_nulls_3.Items)
expression_55 = Expression(O=relative_differences_3, Expression="FORMAT(\"{0:R}\",O)")  # disabled
panel_73 = Panel(expression_55)
quick_graph_5 = QuickGraph(relative_differences_3, SortOrder=0)
multiplication_4 = Multiplication(A=relative_differences_3, B=digit_scroller_8)
line_sdl_10 = LineSDL(Start=divide_curve.Points, Direction=Vector(0, 1, 0), Length=multiplication_4)  # disabled
move_10 = Move(Geometry=line_sdl_10, Motion=vector_xyz_4.Vector)  # -> Geometry, Transform
evaluate_length_20 = EvaluateLength(Curve=move_10.Geometry, Length=1, Normalized=True)  # -> Point, Tangent, Parameter
interpolate_4 = Interpolate(Vertices=evaluate_length_20.Point, Degree=1, Periodic=False, KnotStyle=2)  # -> Curve, Length, Domain

vector_xyz_5 = VectorXYZ(XComponent=expr("-X", series_5), YComponent=4, ZComponent=0)  # -> Vector, Length
replace_nulls_4 = ReplaceNulls(Items=relative_differences_3, Replacements=0)  # -> Items, Count
relative_differences_4 = RelativeDifferences(Values=replace_nulls_4.Items)
expression_56 = Expression(O=relative_differences_4, Expression="FORMAT(\"{0:R}\",O)")  # disabled
panel_74 = Panel(expression_56)
quick_graph_6 = QuickGraph(relative_differences_4, SortOrder=0)
multiplication_5 = Multiplication(A=relative_differences_4, B=digit_scroller_7)
line_sdl_11 = LineSDL(Start=divide_curve.Points, Direction=Vector(0, 1, 0), Length=multiplication_5)  # disabled
move_11 = Move(Geometry=line_sdl_11, Motion=vector_xyz_5.Vector)  # -> Geometry, Transform
evaluate_length_21 = EvaluateLength(Curve=move_11.Geometry, Length=1, Normalized=True)  # -> Point, Tangent, Parameter
interpolate_5 = Interpolate(Vertices=evaluate_length_21.Point, Degree=1, Periodic=False, KnotStyle=2)  # -> Curve, Length, Domain

vector_xyz_6 = VectorXYZ(XComponent=expr("-X", series_5), YComponent=5, ZComponent=0)  # -> Vector, Length
replace_nulls_5 = ReplaceNulls(Items=relative_differences_4, Replacements=0)  # -> Items, Count
relative_differences_5 = RelativeDifferences(Values=replace_nulls_5.Items)
expression_57 = Expression(O=relative_differences_5, Expression="FORMAT(\"{0:R}\",O)")  # disabled
panel_75 = Panel(expression_57)
quick_graph_7 = QuickGraph(relative_differences_5, SortOrder=0)
multiplication_6 = Multiplication(A=relative_differences_5, B=digit_scroller_13)
line_sdl_12 = LineSDL(Start=divide_curve.Points, Direction=Vector(0, 1, 0), Length=multiplication_6)  # disabled
move_12 = Move(Geometry=line_sdl_12, Motion=vector_xyz_6.Vector)  # -> Geometry, Transform
evaluate_length_22 = EvaluateLength(Curve=move_12.Geometry, Length=1, Normalized=True)  # -> Point, Tangent, Parameter
interpolate_6 = Interpolate(Vertices=evaluate_length_22.Point, Degree=1, Periodic=False, KnotStyle=2)  # -> Curve, Length, Domain

replace_nulls_6 = ReplaceNulls(Items=relative_differences_5, Replacements=0)  # -> Items, Count
relative_differences_6 = RelativeDifferences(Values=replace_nulls_6.Items)

expression_58 = Expression(O=relative_differences_6, Expression="FORMAT(\"{0:R}\",O)")  # disabled
panel_76 = Panel(expression_58)
vector_xyz_7 = VectorXYZ(XComponent=expr("-X", series_5), YComponent=6, ZComponent=0)  # -> Vector, Length
quick_graph_8 = QuickGraph(relative_differences_6, SortOrder=0)
multiplication_7 = Multiplication(A=relative_differences_6, B=digit_scroller_14)
line_sdl_13 = LineSDL(Start=divide_curve.Points, Direction=Vector(0, 1, 0), Length=multiplication_7)  # disabled
move_13 = Move(Geometry=line_sdl_13, Motion=vector_xyz_7.Vector)  # -> Geometry, Transform
evaluate_length_23 = EvaluateLength(Curve=move_13.Geometry, Length=1, Normalized=True)  # -> Point, Tangent, Parameter
interpolate_7 = Interpolate(Vertices=evaluate_length_23.Point, Degree=1, Periodic=False, KnotStyle=2)  # -> Curve, Length, Domain

vector_xyz_8 = VectorXYZ(XComponent=expr("-X", series_5), YComponent=7, ZComponent=0)  # -> Vector, Length
replace_nulls_7 = ReplaceNulls(Items=relative_differences_6, Replacements=0)  # -> Items, Count
relative_differences_7 = RelativeDifferences(Values=replace_nulls_7.Items)
expression_59 = Expression(O=relative_differences_7, Expression="FORMAT(\"{0:R}\",O)")  # disabled
panel_77 = Panel(expression_59)
quick_graph_9 = QuickGraph(relative_differences_7, SortOrder=0)
multiplication_8 = Multiplication(A=relative_differences_7, B=digit_scroller_11)
line_sdl_14 = LineSDL(Start=divide_curve.Points, Direction=Vector(0, 1, 0), Length=multiplication_8)  # disabled
move_14 = Move(Geometry=line_sdl_14, Motion=vector_xyz_8.Vector)  # -> Geometry, Transform
evaluate_length_24 = EvaluateLength(Curve=move_14.Geometry, Length=1, Normalized=True)  # -> Point, Tangent, Parameter
interpolate_8 = Interpolate(Vertices=evaluate_length_24.Point, Degree=1, Periodic=False, KnotStyle=2)  # -> Curve, Length, Domain

vector_xyz_9 = VectorXYZ(XComponent=expr("-X", series_5), YComponent=8, ZComponent=0)  # -> Vector, Length
replace_nulls_8 = ReplaceNulls(Items=relative_differences_7, Replacements=0)  # -> Items, Count
relative_differences_8 = RelativeDifferences(Values=replace_nulls_8.Items)
expression_60 = Expression(O=relative_differences_8, Expression="FORMAT(\"{0:R}\",O)")  # disabled
panel_78 = Panel(expression_60)
quick_graph_10 = QuickGraph(relative_differences_8, SortOrder=0)
multiplication_9 = Multiplication(A=relative_differences_8, B=digit_scroller_15)
line_sdl_15 = LineSDL(Start=divide_curve.Points, Direction=Vector(0, 1, 0), Length=multiplication_9)  # disabled
move_15 = Move(Geometry=line_sdl_15, Motion=vector_xyz_9.Vector)  # -> Geometry, Transform
evaluate_length_25 = EvaluateLength(Curve=move_15.Geometry, Length=1, Normalized=True)  # -> Point, Tangent, Parameter
interpolate_9 = Interpolate(Vertices=evaluate_length_25.Point, Degree=1, Periodic=False, KnotStyle=2)  # -> Curve, Length, Domain

custom_preview = CustomPreview(Geometry=interpolate_5.Curve, Material=create_material)

custom_preview_2 = CustomPreview(Geometry=move_11.Geometry, Material=create_material_2)

custom_preview_3 = CustomPreview(Geometry=interpolate_4.Curve, Material=create_material_3)

custom_preview_4 = CustomPreview(Geometry=move_10.Geometry, Material=create_material_4)

custom_preview_5 = CustomPreview(Geometry=interpolate_3.Curve, Material=create_material_5)

custom_preview_6 = CustomPreview(Geometry=move_9.Geometry, Material=create_material_6)

custom_preview_7 = CustomPreview(Geometry=interpolate_2.Curve, Material=create_material_7)

custom_preview_8 = CustomPreview(Geometry=move_8.Geometry, Material=create_material_8)

custom_preview_9 = CustomPreview(Geometry=interpolate.Curve, Material=create_material_9)

custom_preview_10 = CustomPreview(Geometry=move_7.Geometry, Material=create_material_10)

custom_preview_11 = CustomPreview(Geometry=interpolate_9.Curve, Material=create_material_11)

custom_preview_12 = CustomPreview(Geometry=move_15.Geometry, Material=create_material_12)

custom_preview_13 = CustomPreview(Geometry=interpolate_8.Curve, Material=create_material_13)

custom_preview_14 = CustomPreview(Geometry=move_14.Geometry, Material=create_material_14)

custom_preview_15 = CustomPreview(Geometry=interpolate_6.Curve, Material=create_material_15)

custom_preview_16 = CustomPreview(Geometry=move_12.Geometry, Material=create_material_16)

custom_preview_17 = CustomPreview(Geometry=interpolate_7.Curve, Material=create_material_17)

custom_preview_18 = CustomPreview(Geometry=move_13.Geometry, Material=create_material_18)

curve_37 = Curve(graft(curve_31))
divide_curve_3 = DivideCurve(Curve=curve_37, Count=number_7, Kinks=False)  # -> Points, Tangents, Parameters
curvature_2 = Curvature(Curve=curve_37, Parameter=divide_curve_3.Parameters)  # -> Point, Curvature, Curvature_2
deconstruct_arc_2 = DeconstructArc(Arc=curvature_2.Curvature_2)  # -> BasePlane, Radius, Angle
line = Line(StartPoint=curvature_2.Point, EndPoint=deconstruct_arc_2.BasePlane)
one_over_x_2 = OneOverX(Value=deconstruct_arc_2.Radius)
quick_graph_11 = QuickGraph(one_over_x_2, SortOrder=0)
replace_nulls_9 = ReplaceNulls(Items=one_over_x_2, Replacements=0)  # -> Items, Count
relative_differences_9 = RelativeDifferences(Values=replace_nulls_9.Items)
curvature_graph = CurvatureGraph(Curve=curve_37, Density=1, Scale=digit_scroller_26)  # disabled
custom_preview_19 = CustomPreview(Geometry=curve_37, Material=create_material_21)

expression_61 = Expression(O=relative_differences_9, Expression="FORMAT(\"{0:R}\",O)")  # disabled
panel_79 = Panel(expression_61)
quick_graph_12 = QuickGraph(relative_differences_9, SortOrder=0)

expression_62 = Expression(O=one_over_x_2, Expression="FORMAT(\"{0:R}\",O)")  # disabled
panel_80 = Panel(expression_62)

expression_63 = Expression(O=deconstruct_arc_2.Radius, Expression="FORMAT(\"{0:R}\",O)")  # disabled
panel_81 = Panel(expression_63)

torsion = Torsion(Curve=curve_37, Parameter=divide_curve_3.Parameters)  # -> Point, Torsion; disabled
panel_82 = Panel(torsion.Point)

derivatives = Derivatives(Curve=curve_37, Parameter=divide_curve_3.Parameters)  # -> Point, FirstDerivative, SecondDerivative, ThirdDerivative, FourthDerivative, FifthDerivative, SixthDerivative; disabled
quick_graph_13 = QuickGraph(derivatives.SixthDerivative, SortOrder=0)
quick_graph_14 = QuickGraph(derivatives.FifthDerivative, SortOrder=0)
quick_graph_15 = QuickGraph(derivatives.FourthDerivative, SortOrder=0)
quick_graph_16 = QuickGraph(derivatives.ThirdDerivative, SortOrder=0)
quick_graph_17 = QuickGraph(derivatives.SecondDerivative, SortOrder=0)
quick_graph_18 = QuickGraph(derivatives.FirstDerivative, SortOrder=0)
quick_graph_19 = QuickGraph(derivatives.Point, SortOrder=0)
length = Length(Curve=curve_37)

relative_differences_10 = RelativeDifferences(Values=relative_differences_9)

quick_graph_20 = QuickGraph(relative_differences_10, SortOrder=0)
bounds_3 = Bounds(Numbers=relative_differences_10)
remap_numbers = RemapNumbers(Value=relative_differences_10, Source=bounds_3, Target=Domain(-1, 1))  # -> Mapped, Clipped
multiplication_10 = Multiplication(A=remap_numbers.Mapped, B=length)
multiplication_11 = Multiplication(A=multiplication_10, B=digit_scroller_27)

relative_differences_11 = RelativeDifferences(Values=relative_differences_10)

quick_graph_21 = QuickGraph(relative_differences_11, SortOrder=0)

relative_differences_12 = RelativeDifferences(Values=relative_differences_11)

quick_graph_22 = QuickGraph(relative_differences_12, SortOrder=0)
bounds_4 = Bounds(Numbers=relative_differences_12)
remap_numbers_2 = RemapNumbers(Value=relative_differences_12, Source=bounds_4, Target=Domain(-1, 1))  # -> Mapped, Clipped
multiplication_12 = Multiplication(A=remap_numbers_2.Mapped, B=length)
multiplication_13 = Multiplication(A=multiplication_12, B=digit_scroller_3)

relative_differences_13 = RelativeDifferences(Values=relative_differences_12)

relative_differences_14 = RelativeDifferences(Values=relative_differences_13)

quick_graph_23 = QuickGraph(relative_differences_14, SortOrder=0)
bounds_5 = Bounds(Numbers=relative_differences_14)
remap_numbers_3 = RemapNumbers(Value=relative_differences_14, Source=bounds_5, Target=Domain(-1, 1))  # -> Mapped, Clipped
multiplication_14 = Multiplication(A=remap_numbers_3.Mapped, B=length)
multiplication_15 = Multiplication(A=multiplication_14, B=digit_scroller_2)

relative_differences_15 = RelativeDifferences(Values=relative_differences_14)

quick_graph_24 = QuickGraph(relative_differences_15, SortOrder=0)
bounds_6 = Bounds(Numbers=relative_differences_15)
remap_numbers_4 = RemapNumbers(Value=relative_differences_15, Source=bounds_6, Target=Domain(-1, 1))  # -> Mapped, Clipped
multiplication_16 = Multiplication(A=remap_numbers_4.Mapped, B=length)
multiplication_17 = Multiplication(A=multiplication_16, B=digit_scroller_23)

relative_differences_16 = RelativeDifferences(Values=relative_differences_15)

quick_graph_25 = QuickGraph(relative_differences_16, SortOrder=0)
bounds_7 = Bounds(Numbers=relative_differences_16)
remap_numbers_5 = RemapNumbers(Value=relative_differences_16, Source=bounds_7, Target=Domain(-1, 1))  # -> Mapped, Clipped
multiplication_18 = Multiplication(A=remap_numbers_5.Mapped, B=length)
multiplication_19 = Multiplication(A=multiplication_18, B=digit_scroller)

quick_graph_26 = QuickGraph(relative_differences_13, SortOrder=0)
bounds_8 = Bounds(Numbers=relative_differences_13)
remap_numbers_6 = RemapNumbers(Value=relative_differences_13, Source=bounds_8, Target=Domain(-1, 1))  # -> Mapped, Clipped
multiplication_20 = Multiplication(A=remap_numbers_6.Mapped, B=length)
multiplication_21 = Multiplication(A=multiplication_20, B=digit_scroller_4)

bounds_9 = Bounds(Numbers=relative_differences_11)
remap_numbers_7 = RemapNumbers(Value=relative_differences_11, Source=bounds_9, Target=Domain(-1, 1))  # -> Mapped, Clipped

bounds_10 = Bounds(Numbers=relative_differences_9)
remap_numbers_8 = RemapNumbers(Value=relative_differences_9, Source=bounds_10, Target=Domain(-1, 1))  # -> Mapped, Clipped

bounds_11 = Bounds(Numbers=one_over_x_2)
remap_numbers_9 = RemapNumbers(Value=one_over_x_2, Source=bounds_11, Target=Domain(0, 1))  # -> Mapped, Clipped

multiplication_22 = Multiplication(A=remap_numbers_7.Mapped, B=length)

multiplication_23 = Multiplication(A=multiplication_22, B=digit_scroller_24)

multiplication_24 = Multiplication(A=remap_numbers_8.Mapped, B=length)
multiplication_25 = Multiplication(A=length, B=remap_numbers_9.Mapped)

multiplication_26 = Multiplication(A=multiplication_24, B=digit_scroller_28)

multiplication_27 = Multiplication(A=multiplication_25, B=Slider(0.043752, range=0..2))

line_sdl_16 = LineSDL(Start=curvature_2.Point, Direction=line, Length=expr("-X", multiplication_27))
evaluate_length_26 = EvaluateLength(Curve=line_sdl_16, Length=1, Normalized=True)  # -> Point, Tangent, Parameter
interpolate_10 = Interpolate(Vertices=evaluate_length_26.Point, Degree=1, Periodic=False, KnotStyle=2)  # -> Curve, Length, Domain
custom_preview_20 = CustomPreview(Geometry=line_sdl_16, Material=create_material_20)
curve_38 = Curve(interpolate_10.Curve)
custom_preview_21 = CustomPreview(Geometry=curve_38, Material=create_material_19)

line_sdl_17 = LineSDL(Start=evaluate_length_26.Point, Direction=line_sdl_16, Length=expr("ABS(X)", multiplication_26))
nurbs_curve = NurbsCurve(Vertices=evaluate_length_26.Point, Degree=3, Periodic=False)  # -> Curve, Length, Domain
custom_preview_22 = CustomPreview(Geometry=line_sdl_17, Material=create_material_25)
curve_39 = Curve(line_sdl_17)
evaluate_length_27 = EvaluateLength(Curve=curve_39, Length=1, Normalized=True)  # -> Point, Tangent, Parameter
line_sdl_18 = LineSDL(Start=evaluate_length_27.Point, Direction=derivatives.ThirdDerivative, Length=expr("-X", multiplication_26))
evaluate_length_28 = EvaluateLength(Curve=line_sdl_18, Length=1, Normalized=True)  # -> Point, Tangent, Parameter
interpolate_11 = Interpolate(Vertices=evaluate_length_28.Point, Degree=3, Periodic=False, KnotStyle=2)  # -> Curve, Length, Domain
custom_preview_23 = CustomPreview(Geometry=interpolate_11.Curve, Material=create_material_22)
custom_preview_24 = CustomPreview(Geometry=line_sdl_18, Material=create_material_23)
interpolate_12 = Interpolate(Vertices=evaluate_length_27.Point, Degree=1, Periodic=False, KnotStyle=2)  # -> Curve, Length, Domain
polyline = PolyLine(Vertices=evaluate_length_27.Point, Closed=False)
explode = Explode(Curve=polyline, Recursive=True)  # -> Segments, Vertices
custom_preview_25 = CustomPreview(Geometry=interpolate_12.Curve, Material=create_material_24)
curve_40 = Curve(flatten(explode.Segments))
length_2 = Length(Curve=curve_40)
sort_list = SortList(Keys=length_2, ValuesValuesA=curve_40)  # -> Keys, ValuesValuesA
list_item = ListItem(List=sort_list.Keys, Index=0, Wrap=False)
dot_display = DotDisplay(Point=evaluate_length_27.Point, Colour=RGB(194, 194, 194), Size=expr("X/2", list_item))

expression_64 = Expression(O=sort_list.Keys, Expression="FORMAT(\"{0:R}\",O)")  # disabled
panel_83 = Panel(expression_64)

line_sdl_19 = LineSDL(Start=evaluate_length_27.Point, Direction=line_sdl_16, Length=expr("ABS(X)", multiplication_11))

evaluate_length_29 = EvaluateLength(Curve=line_sdl_19, Length=1, Normalized=True)  # -> Point, Tangent, Parameter
interpolate_13 = Interpolate(Vertices=evaluate_length_29.Point, Degree=1, Periodic=False, KnotStyle=2)  # -> Curve, Length, Domain
custom_preview_26 = CustomPreview(Geometry=interpolate_13.Curve, Material=create_material_38)
custom_preview_27 = CustomPreview(Geometry=line_sdl_19, Material=create_material_39)

line_sdl_20 = LineSDL(Start=evaluate_length_29.Point, Direction=line_sdl_16, Length=expr("ABS(X)", multiplication_23))

evaluate_length_30 = EvaluateLength(Curve=line_sdl_20, Length=1, Normalized=True)  # -> Point, Tangent, Parameter
interpolate_14 = Interpolate(Vertices=evaluate_length_30.Point, Degree=1, Periodic=False, KnotStyle=2)  # -> Curve, Length, Domain
custom_preview_28 = CustomPreview(Geometry=interpolate_14.Curve, Material=create_material_36)
custom_preview_29 = CustomPreview(Geometry=line_sdl_20, Material=create_material_37)

line_sdl_21 = LineSDL(Start=evaluate_length_30.Point, Direction=line_sdl_16, Length=expr("ABS(X)", multiplication_13))

evaluate_length_31 = EvaluateLength(Curve=line_sdl_21, Length=1, Normalized=True)  # -> Point, Tangent, Parameter
interpolate_15 = Interpolate(Vertices=evaluate_length_31.Point, Degree=1, Periodic=False, KnotStyle=2)  # -> Curve, Length, Domain
custom_preview_30 = CustomPreview(Geometry=interpolate_15.Curve, Material=create_material_34)
custom_preview_31 = CustomPreview(Geometry=line_sdl_21, Material=create_material_35)

line_sdl_22 = LineSDL(Start=evaluate_length_31.Point, Direction=line_sdl_16, Length=expr("ABS(X)", multiplication_21))  # disabled

evaluate_length_32 = EvaluateLength(Curve=line_sdl_22, Length=1, Normalized=True)  # -> Point, Tangent, Parameter
interpolate_16 = Interpolate(Vertices=evaluate_length_32.Point, Degree=1, Periodic=False, KnotStyle=2)  # -> Curve, Length, Domain
custom_preview_32 = CustomPreview(Geometry=interpolate_16.Curve, Material=create_material_32)
custom_preview_33 = CustomPreview(Geometry=line_sdl_22, Material=create_material_33)

line_sdl_23 = LineSDL(Start=evaluate_length_32.Point, Direction=line_sdl_16, Length=expr("ABS(X)", multiplication_15))  # disabled

evaluate_length_33 = EvaluateLength(Curve=line_sdl_23, Length=1, Normalized=True)  # -> Point, Tangent, Parameter
interpolate_17 = Interpolate(Vertices=evaluate_length_33.Point, Degree=1, Periodic=False, KnotStyle=2)  # -> Curve, Length, Domain
custom_preview_34 = CustomPreview(Geometry=interpolate_17.Curve, Material=create_material_30)
custom_preview_35 = CustomPreview(Geometry=line_sdl_23, Material=create_material_31)

line_sdl_24 = LineSDL(Start=evaluate_length_33.Point, Direction=line_sdl_16, Length=expr("ABS(X)", multiplication_17))  # disabled

evaluate_length_34 = EvaluateLength(Curve=line_sdl_24, Length=1, Normalized=True)  # -> Point, Tangent, Parameter
interpolate_18 = Interpolate(Vertices=evaluate_length_34.Point, Degree=1, Periodic=False, KnotStyle=2)  # -> Curve, Length, Domain
custom_preview_36 = CustomPreview(Geometry=interpolate_18.Curve, Material=create_material_28)
custom_preview_37 = CustomPreview(Geometry=line_sdl_24, Material=create_material_29)

line_sdl_25 = LineSDL(Start=evaluate_length_34.Point, Direction=line_sdl_16, Length=expr("ABS(X)", multiplication_19))  # disabled

evaluate_length_35 = EvaluateLength(Curve=line_sdl_25, Length=1, Normalized=True)  # -> Point, Tangent, Parameter
interpolate_19 = Interpolate(Vertices=evaluate_length_35.Point, Degree=1, Periodic=False, KnotStyle=2)  # -> Curve, Length, Domain
custom_preview_38 = CustomPreview(Geometry=interpolate_19.Curve, Material=create_material_26)
custom_preview_39 = CustomPreview(Geometry=line_sdl_25, Material=create_material_27)
