# Grasshopper definition XHG.⠀ⵙ⠀∷⠀ⵙ⠀⊚⠀ⵙ⠀ᴥ⠀ⵙ⠀ᗱᗴ⠀ⵙ⠀✤⠀ⵙ⠀ᗱᗴ⠀ⵙ⠀ᙏ⠀ⵙ⠀◯⠀ⵙ⠀ᗱᗴ⠀ⵙ⠀ᑐᑕ⠀ⵙ⠀ИN⠀ⵙ⠀ᗱᗴ⠀ⵙ⠀ᴥ⠀ⵙ⠀ᗱᗴ⠀ⵙ⠀ꗳ⠀ⵙ⠀ꖴ⠀ⵙ⠀ᗝ⠀ⵙ⠀◯⠀ⵙ⠀ᗱᗴ⠀ⵙ⠀ᴥ⠀ⵙ⠀ᑎ⠀ⵙ⠀✤⠀ⵙ⠀ᗩ⠀ⵙ⠀ᗯ⠀ⵙ⠀ᴥ⠀ⵙ⠀ᑎ⠀ⵙ⠀ᑐᑕ⠀ⵙ⠀◯⠀ⵙ⠀◯⠀ⵙ⠀ᑐᑕ⠀ⵙ⠀ᑎ⠀ⵙ⠀ᴥ⠀ⵙ⠀ᗯ⠀ⵙ⠀ᗩ⠀ⵙ⠀✤⠀ⵙ⠀ᑎ⠀ⵙ⠀ᴥ⠀ⵙ⠀ᗱᗴ⠀ⵙ⠀◯⠀ⵙ⠀ᗝ⠀ⵙ⠀ꖴ⠀ⵙ⠀ꗳ⠀ⵙ⠀ᗱᗴ⠀ⵙ⠀ᴥ⠀ⵙ⠀ᗱᗴ⠀ⵙ⠀ИN⠀ⵙ⠀ᑐᑕ⠀ⵙ⠀ᗱᗴ⠀ⵙ⠀◯⠀ⵙ⠀ᙏ⠀ⵙ⠀ᗱᗴ⠀ⵙ⠀✤⠀ⵙ⠀ᗱᗴ⠀ⵙ⠀ᴥ⠀ⵙ⠀⊚⠀ⵙ⠀∷⠀ⵙ⠀.GHX (Grasshopper 1.0.7)
# plug-ins: Pufferfish, Heteroptera

panel = Panel("0.00000331207")
panel_2 = Panel("0.0000710748925500000001421")
panel_3 = Panel("0.0013733120705119695")
panel_5 = Panel("0.00137956207")  # disabled
digit_scroller = DigitScroller(Scroller_Digits=12, Scroller_Prefix="Digit Scroller", Scroller_Radix=1, Scroller_Value=0.02196259374)  # disabled
panel_7 = Panel(digit_scroller)  # disabled
digit_scroller_2 = DigitScroller(Scroller_Digits=12, Scroller_Prefix="Digit Scroller", Scroller_Radix=1, Scroller_Value=7.7777e-05)  # disabled
digit_scroller_3 = DigitScroller(Scroller_Digits=12, Scroller_Prefix=" ", Scroller_Radix=11, Scroller_Value=256)
series = Series(Start=0, Step=expr("1/X", digit_scroller_3), Count=expr("X+1", digit_scroller_3))
expression = Expression(X=series, Expression="-COS(4*ATAN(1)*X)/2+.5")
construct_point = ConstructPoint(XCoordinate=series, YCoordinate=expression, ZCoordinate=0)
interpolate = Interpolate(Vertices=construct_point, Degree=3, Periodic=False, KnotStyle=1)  # -> Curve, Length, Domain; disabled
curve = Curve()
panel_8 = Panel("0.00137956207")
panel_9 = Panel("""0.00032220000
0.00000220000""")
panel_10 = Panel("0.00137956207*4*4*4*4")

digit_scroller_4 = DigitScroller(Scroller_Digits=12, Scroller_Prefix=" ", Scroller_Radix=6, Scroller_Value=0.13)  # disabled

digit_scroller_5 = DigitScroller(Scroller_Digits=12, Scroller_Prefix=" ", Scroller_Radix=6, Scroller_Value=0.1)  # disabled

digit_scroller_6 = DigitScroller(Scroller_Digits=12, Scroller_Prefix=" ", Scroller_Radix=3, Scroller_Value=0.17)  # disabled

digit_scroller_7 = DigitScroller(Scroller_Digits=12, Scroller_Prefix="Digit Scroller", Scroller_Radix=9, Scroller_Value=57.5)  # disabled

digit_scroller_8 = DigitScroller(Scroller_Digits=12, Scroller_Prefix="Digit Scroller", Scroller_Radix=1, Scroller_Value=7.5243e-06)
digit_scroller_9 = DigitScroller(Scroller_Digits=12, Scroller_Prefix="Digit Scroller", Scroller_Radix=1, Scroller_Value=7.7777e-05)
digit_scroller_10 = DigitScroller(Scroller_Digits=12, Scroller_Prefix="Digit Scroller", Scroller_Radix=1, Scroller_Value=0.02196259374)
panel_13 = Panel(digit_scroller_10)
digit_scroller_11 = DigitScroller(Scroller_Digits=12, Scroller_Prefix="Digit Scroller", Scroller_Radix=1, Scroller_Value=7.7777e-05)
panel_15 = Panel("0.00137956207*4*4*4*4")  # disabled
panel_16 = Panel("""0.00032220000
0.00000220000""")  # disabled
digit_scroller_12 = DigitScroller(Scroller_Digits=12, Scroller_Prefix="Digit Scroller", Scroller_Radix=1, Scroller_Value=7.5243e-06)  # disabled
digit_scroller_13 = DigitScroller(Scroller_Digits=12, Scroller_Prefix="Digit Scroller", Scroller_Radix=1, Scroller_Value=7.7777e-05)  # disabled
digit_scroller_14 = DigitScroller(Scroller_Digits=12, Scroller_Prefix="Digit Scroller", Scroller_Radix=1, Scroller_Value=0.02196259374)  # disabled
panel_19 = Panel(digit_scroller_14)  # disabled
digit_scroller_15 = DigitScroller(Scroller_Digits=12, Scroller_Prefix="Digit Scroller", Scroller_Radix=1, Scroller_Value=7.7777e-05)  # disabled
infoglasses = InfoGlasses(
    Run=True,
    Language=0,
    BackGroundColor=RGB(255, 255, 255),
    BoundaryColor=RGB(214, 214, 214),
    English=True,
    TextColor=RGB(128, 128, 128),
    cateSet=False,
    nameBoxDistance=0,
    showName=True,
    showNickName=False)
digit_scroller_16 = DigitScroller(Scroller_Digits=12, Scroller_Prefix="Digit Scroller", Scroller_Radix=1, Scroller_Value=7.5243e-06)  # disabled
digit_scroller_17 = DigitScroller(Scroller_Digits=12, Scroller_Prefix="Digit Scroller", Scroller_Radix=1, Scroller_Value=7.7777e-05)  # disabled
digit_scroller_18 = DigitScroller(Scroller_Digits=12, Scroller_Prefix="Digit Scroller", Scroller_Radix=1, Scroller_Value=0.02196259374)  # disabled
panel_25 = Panel(digit_scroller_18)  # disabled
digit_scroller_19 = DigitScroller(Scroller_Digits=12, Scroller_Prefix="Digit Scroller", Scroller_Radix=1, Scroller_Value=7.7777e-05)  # disabled
digit_scroller_20 = DigitScroller(Scroller_Digits=12, Scroller_Prefix="Digit Scroller", Scroller_Radix=1, Scroller_Value=0.02196259374)  # disabled
panel_31 = Panel(digit_scroller_20)  # disabled
digit_scroller_21 = DigitScroller(Scroller_Digits=12, Scroller_Prefix="Digit Scroller", Scroller_Radix=1, Scroller_Value=7.7777e-05)  # disabled
digit_scroller_22 = DigitScroller(Scroller_Digits=12, Scroller_Prefix="Digit Scroller", Scroller_Radix=1, Scroller_Value=7.5243e-06)  # disabled
digit_scroller_23 = DigitScroller(Scroller_Digits=12, Scroller_Prefix="Digit Scroller", Scroller_Radix=1, Scroller_Value=7.7777e-05)  # disabled
digit_scroller_24 = DigitScroller(Scroller_Digits=12, Scroller_Prefix="Digit Scroller", Scroller_Radix=1, Scroller_Value=7.5243e-06)  # disabled
digit_scroller_25 = DigitScroller(Scroller_Digits=12, Scroller_Prefix="Digit Scroller", Scroller_Radix=1, Scroller_Value=7.7777e-05)  # disabled

digit_scroller_26 = DigitScroller(Scroller_Digits=12, Scroller_Prefix=" ", Scroller_Radix=2, Scroller_Value=16)
number = Number(digit_scroller_26)

digit_scroller_27 = DigitScroller(Scroller_Digits=12, Scroller_Prefix="Digit Scroller", Scroller_Radix=1, Scroller_Value=7.5243e-06)  # disabled
digit_scroller_28 = DigitScroller(Scroller_Digits=12, Scroller_Prefix="Digit Scroller", Scroller_Radix=1, Scroller_Value=7.7777e-05)  # disabled
digit_scroller_29 = DigitScroller(Scroller_Digits=12, Scroller_Prefix="Digit Scroller", Scroller_Radix=1, Scroller_Value=7.5243e-06)  # disabled
digit_scroller_30 = DigitScroller(Scroller_Digits=12, Scroller_Prefix="Digit Scroller", Scroller_Radix=1, Scroller_Value=7.7777e-05)  # disabled
digit_scroller_31 = DigitScroller(Scroller_Digits=12, Scroller_Prefix=" ", Scroller_Radix=2, Scroller_Value=0)  # disabled
digit_scroller_32 = DigitScroller(Scroller_Digits=12, Scroller_Prefix="Digit Scroller", Scroller_Radix=1, Scroller_Value=0.02196259374)  # disabled
panel_43 = Panel(digit_scroller_32)  # disabled
digit_scroller_33 = DigitScroller(Scroller_Digits=12, Scroller_Prefix="Digit Scroller", Scroller_Radix=1, Scroller_Value=7.7777e-05)  # disabled

digit_scroller_34 = DigitScroller(Scroller_Digits=12, Scroller_Prefix=" ", Scroller_Radix=2, Scroller_Value=0)  # disabled
digit_scroller_35 = DigitScroller(Scroller_Digits=12, Scroller_Prefix=" ", Scroller_Radix=2, Scroller_Value=30.9312132)  # disabled
panel_44 = Panel("16.93121320041889709")  # disabled
curve_2 = Curve(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)  # disabled
curve_3 = Curve(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)  # disabled

digit_scroller_36 = DigitScroller(Scroller_Digits=12, Scroller_Prefix="Digit Scroller", Scroller_Radix=5, Scroller_Value=20817.02838)  # disabled

digit_scroller_37 = DigitScroller(Scroller_Digits=12, Scroller_Prefix="Digit Scroller", Scroller_Radix=4, Scroller_Value=2233.523438)  # disabled

digit_scroller_38 = DigitScroller(Scroller_Digits=12, Scroller_Prefix="Digit Scroller", Scroller_Radix=4, Scroller_Value=281.0810667)  # disabled
line_sdl = LineSDL(Start=Point(-2.121093912, 1.99985794, 0), Direction=Vector(0.0625, 0.0625, 0), Length=1)  # disabled

digit_scroller_39 = DigitScroller(Scroller_Digits=12, Scroller_Prefix="Digit Scroller", Scroller_Radix=3, Scroller_Value=0.0689)  # disabled
line_sdl_2 = LineSDL(Start=Point(0, 0, 0), Direction=Vector(1, 0, 0), Length=1)  # disabled

digit_scroller_40 = DigitScroller(Scroller_Digits=12, Scroller_Prefix="Digit Scroller", Scroller_Radix=6, Scroller_Value=383463.9766)  # disabled

digit_scroller_41 = DigitScroller(Scroller_Digits=12, Scroller_Prefix="Digit Scroller", Scroller_Radix=3, Scroller_Value=4.392015)  # disabled

digit_scroller_42 = DigitScroller(Scroller_Digits=12, Scroller_Prefix="Digit Scroller", Scroller_Radix=5, Scroller_Value=56336.19681)  # disabled

digit_scroller_43 = DigitScroller(Scroller_Digits=12, Scroller_Prefix="Digit Scroller", Scroller_Radix=6, Scroller_Value=271915.0063)  # disabled

digit_scroller_44 = DigitScroller(Scroller_Digits=12, Scroller_Prefix="Digit Scroller", Scroller_Radix=7, Scroller_Value=2183007.899)  # disabled

panel_45 = Panel("""0    256    0.0013733120705119695
0    4096    0.0000053644183496292""")
digit_scroller_45 = DigitScroller(Scroller_Digits=12, Scroller_Prefix=" ", Scroller_Radix=11, Scroller_Value=64)
digit_scroller_46 = DigitScroller(Scroller_Digits=12, Scroller_Prefix="Digit Scroller", Scroller_Radix=1, Scroller_Value=5.243e-07)

create_material = CreateMaterial(Diffuse=RGB(191, 191, 191), Specular=RGB(0, 255, 255), Emission=RGB(0, 0, 0), Transparency=0.5, Shine=100)  # disabled

create_material_2 = CreateMaterial(Diffuse=RGB(217, 217, 217), Specular=RGB(0, 255, 255), Emission=RGB(0, 0, 0), Transparency=0.5, Shine=100)  # disabled

create_material_3 = CreateMaterial(Diffuse=RGB(199, 199, 199), Specular=RGB(0, 255, 255), Emission=RGB(0, 0, 0), Transparency=0.5, Shine=100)  # disabled

create_material_4 = CreateMaterial(Diffuse=RGB(224, 224, 224), Specular=RGB(0, 255, 255), Emission=RGB(0, 0, 0), Transparency=0.5, Shine=100)  # disabled

create_material_5 = CreateMaterial(Diffuse=RGB(207, 207, 207), Specular=RGB(0, 255, 255), Emission=RGB(0, 0, 0), Transparency=0.5, Shine=100)  # disabled

create_material_6 = CreateMaterial(Diffuse=RGB(232, 232, 232), Specular=RGB(0, 255, 255), Emission=RGB(0, 0, 0), Transparency=0.5, Shine=100)  # disabled

create_material_7 = CreateMaterial(Diffuse=RGB(214, 214, 214), Specular=RGB(0, 255, 255), Emission=RGB(0, 0, 0), Transparency=0.5, Shine=100)  # disabled

create_material_8 = CreateMaterial(Diffuse=RGB(240, 240, 240), Specular=RGB(0, 255, 255), Emission=RGB(0, 0, 0), Transparency=0.5, Shine=100)  # disabled

create_material_9 = CreateMaterial(Diffuse=RGB(222, 222, 222), Specular=RGB(0, 255, 255), Emission=RGB(0, 0, 0), Transparency=0.5, Shine=100)  # disabled

create_material_10 = CreateMaterial(Diffuse=RGB(247, 247, 247), Specular=RGB(0, 255, 255), Emission=RGB(0, 0, 0), Transparency=0.5, Shine=100)  # disabled

create_material_11 = CreateMaterial(Diffuse=RGB(161, 161, 161), Specular=RGB(0, 255, 255), Emission=RGB(0, 0, 0), Transparency=0.5, Shine=100)  # disabled

create_material_12 = CreateMaterial(Diffuse=RGB(186, 186, 186), Specular=RGB(0, 255, 255), Emission=RGB(0, 0, 0), Transparency=0.5, Shine=100)  # disabled

create_material_13 = CreateMaterial(Diffuse=RGB(168, 168, 168), Specular=RGB(0, 255, 255), Emission=RGB(0, 0, 0), Transparency=0.5, Shine=100)  # disabled

create_material_14 = CreateMaterial(Diffuse=RGB(194, 194, 194), Specular=RGB(0, 255, 255), Emission=RGB(0, 0, 0), Transparency=0.5, Shine=100)  # disabled

create_material_15 = CreateMaterial(Diffuse=RGB(184, 184, 184), Specular=RGB(0, 255, 255), Emission=RGB(0, 0, 0), Transparency=0.5, Shine=100)  # disabled

create_material_16 = CreateMaterial(Diffuse=RGB(209, 209, 209), Specular=RGB(0, 255, 255), Emission=RGB(0, 0, 0), Transparency=0.5, Shine=100)  # disabled

create_material_17 = CreateMaterial(Diffuse=RGB(176, 176, 176), Specular=RGB(0, 255, 255), Emission=RGB(0, 0, 0), Transparency=0.5, Shine=100)  # disabled

create_material_18 = CreateMaterial(Diffuse=RGB(201, 201, 201), Specular=RGB(0, 255, 255), Emission=RGB(0, 0, 0), Transparency=0.5, Shine=100)  # disabled

digit_scroller_47 = DigitScroller(Scroller_Digits=12, Scroller_Prefix=" ", Scroller_Radix=7, Scroller_Value=0)

digit_scroller_48 = DigitScroller(Scroller_Digits=12, Scroller_Prefix="Digit Scroller", Scroller_Radix=1, Scroller_Value=7.49e-08)

panel_46 = Panel("0.35721403168191375/4/4")  # disabled
panel_47 = Panel("""1    16    0.35721403168191375
1    256    0.0014014999884235925
1    4096    """)  # disabled
digit_scroller_49 = DigitScroller(Scroller_Digits=12, Scroller_Prefix="Digit Scroller", Scroller_Radix=1, Scroller_Value=0.00140149998)  # disabled
number_slider = Slider(256, range=0..65536)  # disabled

panel_48 = Panel("0.0013733120705119695*4*4")

digit_scroller_50 = DigitScroller(Scroller_Digits=12, Scroller_Prefix=" ", Scroller_Radix=7, Scroller_Value=16)  # disabled

vector_xyz = VectorXYZ(XComponent=0, YComponent=4, ZComponent=0)  # -> Vector, Length; disabled

number_slider_2 = Slider(1, range=0..1)  # disabled

curve_4 = Curve(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)  # disabled

digit_scroller_51 = DigitScroller(Scroller_Digits=12, Scroller_Prefix=" ", Scroller_Radix=2, Scroller_Value=0)
panel_49 = Panel("30.93121320041889709")
panel_50 = Panel("16.93121320041889709")
curve_5 = Curve(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)
curve_6 = Curve(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)

digit_scroller_52 = DigitScroller(Scroller_Digits=12, Scroller_Prefix=" ", Scroller_Radix=2, Scroller_Value=0)
digit_scroller_53 = DigitScroller(Scroller_Digits=12, Scroller_Prefix=" ", Scroller_Radix=2, Scroller_Value=30.9312132)
curve_7 = Curve(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)
curve_8 = Curve(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)

panel_52 = Panel("0.35721403168191375/4/4")
panel_53 = Panel("""1    16    0.35721403168191375
1    256    0.0014014999884235925
1    4096    """)
digit_scroller_54 = DigitScroller(Scroller_Digits=12, Scroller_Prefix="Digit Scroller", Scroller_Radix=1, Scroller_Value=0.00140149998)
number_slider_3 = Slider(256, range=0..65536)

digit_scroller_55 = DigitScroller(Scroller_Digits=12, Scroller_Prefix=" ", Scroller_Radix=4, Scroller_Value=1179.13)  # disabled

digit_scroller_56 = DigitScroller(Scroller_Digits=12, Scroller_Prefix=" ", Scroller_Radix=1, Scroller_Value=0.03125)  # disabled

digit_scroller_57 = DigitScroller(Scroller_Digits=12, Scroller_Prefix=" ", Scroller_Radix=4, Scroller_Value=0.5)  # disabled

digit_scroller_58 = DigitScroller(Scroller_Digits=12, Scroller_Prefix=" ", Scroller_Radix=11, Scroller_Value=256)  # disabled
digit_scroller_59 = DigitScroller(Scroller_Digits=12, Scroller_Prefix=" ", Scroller_Radix=11, Scroller_Value=87)  # disabled
create_material_19 = CreateMaterial(Diffuse=RGB(222, 222, 222), Specular=RGB(0, 255, 255), Emission=RGB(0, 0, 0), Transparency=0.5, Shine=100)  # disabled
create_material_20 = CreateMaterial(Diffuse=RGB(247, 247, 247), Specular=RGB(0, 255, 255), Emission=RGB(0, 0, 0), Transparency=0.5, Shine=100)  # disabled
create_material_21 = CreateMaterial(Diffuse=RGB(176, 176, 176), Specular=RGB(0, 255, 255), Emission=RGB(0, 0, 0), Transparency=0.5, Shine=100)  # disabled

digit_scroller_60 = DigitScroller(Scroller_Digits=12, Scroller_Prefix=" ", Scroller_Radix=4, Scroller_Value=0.01875)  # disabled

digit_scroller_61 = DigitScroller(Scroller_Digits=12, Scroller_Prefix=" ", Scroller_Radix=1, Scroller_Value=0.025)  # disabled

digit_scroller_62 = DigitScroller(Scroller_Digits=12, Scroller_Prefix="Digit Scroller", Scroller_Radix=1, Scroller_Value=0.00140149998)
number_slider_4 = Slider(256, range=0..65536)

create_material_22 = CreateMaterial(Diffuse=RGB(207, 207, 207), Specular=RGB(0, 255, 255), Emission=RGB(0, 0, 0), Transparency=0.5, Shine=100)  # disabled
create_material_23 = CreateMaterial(Diffuse=RGB(232, 232, 232), Specular=RGB(0, 255, 255), Emission=RGB(0, 0, 0), Transparency=0.5, Shine=100)  # disabled
create_material_24 = CreateMaterial(Diffuse=RGB(214, 214, 214), Specular=RGB(0, 255, 255), Emission=RGB(0, 0, 0), Transparency=0.5, Shine=100)  # disabled
create_material_25 = CreateMaterial(Diffuse=RGB(240, 240, 240), Specular=RGB(0, 255, 255), Emission=RGB(0, 0, 0), Transparency=0.5, Shine=100)  # disabled

create_material_26 = CreateMaterial(Diffuse=RGB(161, 161, 161), Specular=RGB(0, 255, 255), Emission=RGB(0, 0, 0), Transparency=0.5, Shine=100)  # disabled
create_material_27 = CreateMaterial(Diffuse=RGB(186, 186, 186), Specular=RGB(0, 255, 255), Emission=RGB(0, 0, 0), Transparency=0.5, Shine=100)  # disabled

create_material_28 = CreateMaterial(Diffuse=RGB(168, 168, 168), Specular=RGB(0, 255, 255), Emission=RGB(0, 0, 0), Transparency=0.5, Shine=100)  # disabled
create_material_29 = CreateMaterial(Diffuse=RGB(194, 194, 194), Specular=RGB(0, 255, 255), Emission=RGB(0, 0, 0), Transparency=0.5, Shine=100)  # disabled

create_material_30 = CreateMaterial(Diffuse=RGB(176, 176, 176), Specular=RGB(0, 255, 255), Emission=RGB(0, 0, 0), Transparency=0.5, Shine=100)  # disabled
create_material_31 = CreateMaterial(Diffuse=RGB(201, 201, 201), Specular=RGB(0, 255, 255), Emission=RGB(0, 0, 0), Transparency=0.5, Shine=100)  # disabled

create_material_32 = CreateMaterial(Diffuse=RGB(184, 184, 184), Specular=RGB(0, 255, 255), Emission=RGB(0, 0, 0), Transparency=0.5, Shine=100)  # disabled
create_material_33 = CreateMaterial(Diffuse=RGB(209, 209, 209), Specular=RGB(0, 255, 255), Emission=RGB(0, 0, 0), Transparency=0.5, Shine=100)  # disabled

create_material_34 = CreateMaterial(Diffuse=RGB(191, 191, 191), Specular=RGB(0, 255, 255), Emission=RGB(0, 0, 0), Transparency=0.5, Shine=100)  # disabled
create_material_35 = CreateMaterial(Diffuse=RGB(217, 217, 217), Specular=RGB(0, 255, 255), Emission=RGB(0, 0, 0), Transparency=0.5, Shine=100)  # disabled

create_material_36 = CreateMaterial(Diffuse=RGB(199, 199, 199), Specular=RGB(0, 255, 255), Emission=RGB(0, 0, 0), Transparency=0.5, Shine=100)  # disabled
create_material_37 = CreateMaterial(Diffuse=RGB(224, 224, 224), Specular=RGB(0, 255, 255), Emission=RGB(0, 0, 0), Transparency=0.5, Shine=100)  # disabled

create_material_38 = CreateMaterial(Diffuse=RGB(207, 207, 207), Specular=RGB(0, 255, 255), Emission=RGB(0, 0, 0), Transparency=0.5, Shine=100)  # disabled
create_material_39 = CreateMaterial(Diffuse=RGB(232, 232, 232), Specular=RGB(0, 255, 255), Emission=RGB(0, 0, 0), Transparency=0.5, Shine=100)  # disabled

digit_scroller_63 = DigitScroller(Scroller_Digits=12, Scroller_Prefix=" ", Scroller_Radix=7, Scroller_Value=16)

number_slider_5 = Slider(1, range=0..1)

curve_9 = Curve(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)

digit_scroller_64 = DigitScroller(Scroller_Digits=12, Scroller_Prefix=" ", Scroller_Radix=7, Scroller_Value=16)

vector_xyz_2 = VectorXYZ(XComponent=2.5, YComponent=4, ZComponent=0)  # -> Vector, Length

number_slider_6 = Slider(1, range=0..1)

curve_10 = Curve(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)

digit_scroller_65 = DigitScroller(Scroller_Digits=12, Scroller_Prefix=" ", Scroller_Radix=2, Scroller_Value=0)  # disabled
panel_56 = Panel("30.93121320041889709")  # disabled
curve_11 = Curve(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)  # disabled
curve_12 = Curve(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)  # disabled

digit_scroller_66 = DigitScroller(Scroller_Digits=12, Scroller_Prefix=" ", Scroller_Radix=2, Scroller_Value=0)  # disabled
digit_scroller_67 = DigitScroller(Scroller_Digits=12, Scroller_Prefix=" ", Scroller_Radix=2, Scroller_Value=30.9312132)  # disabled
curve_13 = Curve(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)  # disabled
curve_14 = Curve(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)  # disabled

digit_scroller_68 = DigitScroller(Scroller_Digits=12, Scroller_Prefix="Digit Scroller", Scroller_Radix=1, Scroller_Value=0.00140149998)  # disabled
number_slider_7 = Slider(256, range=0..65536)  # disabled

digit_scroller_69 = DigitScroller(Scroller_Digits=12, Scroller_Prefix="Digit Scroller", Scroller_Radix=1, Scroller_Value=0.00140149998)  # disabled
number_slider_8 = Slider(256, range=0..65536)  # disabled

digit_scroller_70 = DigitScroller(Scroller_Digits=12, Scroller_Prefix=" ", Scroller_Radix=7, Scroller_Value=16)  # disabled

digit_scroller_71 = DigitScroller(Scroller_Digits=12, Scroller_Prefix=" ", Scroller_Radix=7, Scroller_Value=16)  # disabled

number_slider_9 = Slider(1, range=0..1)  # disabled

vector_xyz_3 = VectorXYZ(XComponent=5, YComponent=4, ZComponent=0)  # -> Vector, Length; disabled

number_slider_10 = Slider(1, range=0..1)  # disabled

curve_15 = Curve(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)  # disabled

curve_16 = Curve(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)  # disabled

digit_scroller_72 = DigitScroller(Scroller_Digits=12, Scroller_Prefix=" ", Scroller_Radix=2, Scroller_Value=0.0833333333)

digit_scroller_73 = DigitScroller(Scroller_Digits=12, Scroller_Prefix=" ", Scroller_Radix=1, Scroller_Value=0.09375)

digit_scroller_74 = DigitScroller(Scroller_Digits=12, Scroller_Prefix=" ", Scroller_Radix=11, Scroller_Value=256)
digit_scroller_75 = DigitScroller(Scroller_Digits=12, Scroller_Prefix=" ", Scroller_Radix=11, Scroller_Value=87)
digit_scroller_76 = DigitScroller(Scroller_Digits=12, Scroller_Prefix=" ", Scroller_Radix=1, Scroller_Value=0.03125)
create_material_40 = CreateMaterial(Diffuse=RGB(222, 222, 222), Specular=RGB(0, 255, 255), Emission=RGB(0, 0, 0), Transparency=0.5, Shine=100)
create_material_41 = CreateMaterial(Diffuse=RGB(247, 247, 247), Specular=RGB(0, 255, 255), Emission=RGB(0, 0, 0), Transparency=0.5, Shine=100)
create_material_42 = CreateMaterial(Diffuse=RGB(176, 176, 176), Specular=RGB(0, 255, 255), Emission=RGB(0, 0, 0), Transparency=0.5, Shine=100)

digit_scroller_77 = DigitScroller(Scroller_Digits=12, Scroller_Prefix=" ", Scroller_Radix=3, Scroller_Value=0.166666666)

digit_scroller_78 = DigitScroller(Scroller_Digits=12, Scroller_Prefix=" ", Scroller_Radix=2, Scroller_Value=0.125)

digit_scroller_79 = DigitScroller(Scroller_Digits=12, Scroller_Prefix=" ", Scroller_Radix=1, Scroller_Value=0.125)

digit_scroller_80 = DigitScroller(Scroller_Digits=12, Scroller_Prefix=" ", Scroller_Radix=1, Scroller_Value=0.03125)

digit_scroller_81 = DigitScroller(Scroller_Digits=12, Scroller_Prefix=" ", Scroller_Radix=1, Scroller_Value=0.03125)

create_material_43 = CreateMaterial(Diffuse=RGB(176, 176, 176), Specular=RGB(0, 255, 255), Emission=RGB(0, 0, 0), Transparency=0.5, Shine=100)
create_material_44 = CreateMaterial(Diffuse=RGB(201, 201, 201), Specular=RGB(0, 255, 255), Emission=RGB(0, 0, 0), Transparency=0.5, Shine=100)

create_material_45 = CreateMaterial(Diffuse=RGB(176, 176, 176), Specular=RGB(0, 255, 255), Emission=RGB(0, 0, 0), Transparency=0.5, Shine=100)
create_material_46 = CreateMaterial(Diffuse=RGB(201, 201, 201), Specular=RGB(0, 255, 255), Emission=RGB(0, 0, 0), Transparency=0.5, Shine=100)

create_material_47 = CreateMaterial(Diffuse=RGB(184, 184, 184), Specular=RGB(0, 255, 255), Emission=RGB(0, 0, 0), Transparency=0.5, Shine=100)
create_material_48 = CreateMaterial(Diffuse=RGB(209, 209, 209), Specular=RGB(0, 255, 255), Emission=RGB(0, 0, 0), Transparency=0.5, Shine=100)

create_material_49 = CreateMaterial(Diffuse=RGB(191, 191, 191), Specular=RGB(0, 255, 255), Emission=RGB(0, 0, 0), Transparency=0.5, Shine=100)
create_material_50 = CreateMaterial(Diffuse=RGB(217, 217, 217), Specular=RGB(0, 255, 255), Emission=RGB(0, 0, 0), Transparency=0.5, Shine=100)

create_material_51 = CreateMaterial(Diffuse=RGB(199, 199, 199), Specular=RGB(0, 255, 255), Emission=RGB(0, 0, 0), Transparency=0.5, Shine=100)
create_material_52 = CreateMaterial(Diffuse=RGB(224, 224, 224), Specular=RGB(0, 255, 255), Emission=RGB(0, 0, 0), Transparency=0.5, Shine=100)

create_material_53 = CreateMaterial(Diffuse=RGB(207, 207, 207), Specular=RGB(0, 255, 255), Emission=RGB(0, 0, 0), Transparency=0.5, Shine=100)
create_material_54 = CreateMaterial(Diffuse=RGB(232, 232, 232), Specular=RGB(0, 255, 255), Emission=RGB(0, 0, 0), Transparency=0.5, Shine=100)

create_material_55 = CreateMaterial(Diffuse=RGB(214, 214, 214), Specular=RGB(0, 255, 255), Emission=RGB(0, 0, 0), Transparency=0.5, Shine=100)
create_material_56 = CreateMaterial(Diffuse=RGB(240, 240, 240), Specular=RGB(0, 255, 255), Emission=RGB(0, 0, 0), Transparency=0.5, Shine=100)

vector_xyz_4 = VectorXYZ(XComponent=5, YComponent=1.5, ZComponent=0)  # -> Vector, Length; disabled

digit_scroller_82 = DigitScroller(Scroller_Digits=12, Scroller_Prefix=" ", Scroller_Radix=2, Scroller_Value=0)  # disabled
curve_17 = Curve(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)  # disabled
curve_18 = Curve(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)  # disabled

digit_scroller_83 = DigitScroller(Scroller_Digits=12, Scroller_Prefix=" ", Scroller_Radix=2, Scroller_Value=0)  # disabled
digit_scroller_84 = DigitScroller(Scroller_Digits=12, Scroller_Prefix=" ", Scroller_Radix=2, Scroller_Value=30.9312132)  # disabled
curve_19 = Curve(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)  # disabled
curve_20 = Curve(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)  # disabled

button = Button()  # disabled
file_path = FilePath("C:\VSC.O____STNEMGES_215____ERUTAWRUC_RAENIL_DEPAM_EMIT_1_HTOMS_LEVEL_4_DIOMGIS_NOITISNART_EGDE_LUF____O____FUL_EDGE_TRANSITION_SIGMOID_4_LEVEL_SMOTH_1_TIME_MAPED_LINEAR_CURWATURE____512_SEGMENTS____O.CSV")  # disabled

digit_scroller_85 = DigitScroller(Scroller_Digits=12, Scroller_Prefix="Digit Scroller", Scroller_Radix=1, Scroller_Value=0.00140149998)  # disabled
number_slider_11 = Slider(256, range=0..65536)  # disabled

digit_scroller_86 = DigitScroller(Scroller_Digits=12, Scroller_Prefix="Digit Scroller", Scroller_Radix=1, Scroller_Value=0.00140149998)  # disabled
number_slider_12 = Slider(256, range=0..65536)  # disabled

digit_scroller_87 = DigitScroller(Scroller_Digits=12, Scroller_Prefix=" ", Scroller_Radix=7, Scroller_Value=16)  # disabled

number_slider_13 = Slider(1, range=0..1)  # disabled

digit_scroller_88 = DigitScroller(Scroller_Digits=12, Scroller_Prefix=" ", Scroller_Radix=7, Scroller_Value=16)  # disabled

vector_xyz_5 = VectorXYZ(XComponent=7.5, YComponent=4, ZComponent=0)  # -> Vector, Length; disabled

curve_21 = Curve(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)  # disabled

number_slider_14 = Slider(1, range=0..1)  # disabled

curve_22 = Curve(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)  # disabled

digit_scroller_89 = DigitScroller(Scroller_Digits=12, Scroller_Prefix="Digit Scroller", Scroller_Radix=11, Scroller_Value=16)  # disabled
construct_point_2 = ConstructPoint(XCoordinate=0.5, YCoordinate=0.5, ZCoordinate=0)  # -> flatten(Point); disabled
line_sdl_3 = LineSDL(Start=Point(0, 0, 0), Direction=Vector(1, 0, 0), Length=expr("X/2", 1))  # disabled
button_2 = Button()  # disabled
file_path_2 = FilePath("C:\IICSA.O__4201_EDIWID_1_TNEMERCNI__TNEIDARG_PUKOOL_ROLOC_HTOMS_3_DIOMGIS_ERUTAWRUC_RAENIL_DEPAM_4_NOITISNART_EGDE_LUF_EKUN__O__NUKE_FUL_EDGE_TRANSITION_4_MAPED_LINEAR_CURWATURE_SIGMOID_3_SMOTH_COLOR_LOOKUP_GRADIENT__INCREMENT_1_DIWIDE_1024__O.ASCII")  # disabled
number_2 = Number(digit_scroller_89)  # disabled

vector_xyz_6 = VectorXYZ(XComponent=7.5, YComponent=1.5, ZComponent=0)  # -> Vector, Length; disabled

button_3 = Button()  # disabled
file_path_3 = FilePath("C:\VSC.O____STNEMGES_4201____HTOMS_LEVEL_3_DIOMGIS_ERUTAWRUC_RAENIL_DEPAM_SEMIT_4_NOITISNART_EGDE_LUF____O____FUL_EDGE_TRANSITION_4_TIMES_MAPED_LINEAR_CURWATURE_SIGMOID_3_LEVEL_SMOTH____1024_SEGMENTS____O.CSV")  # disabled

digit_scroller_90 = DigitScroller(Scroller_Digits=12, Scroller_Prefix=" ", Scroller_Radix=2, Scroller_Value=30.9312132)  # disabled
digit_scroller_91 = DigitScroller(Scroller_Digits=12, Scroller_Prefix=" ", Scroller_Radix=2, Scroller_Value=0)  # disabled
curve_23 = Curve(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)  # disabled
curve_24 = Curve(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)  # disabled

digit_scroller_92 = DigitScroller(Scroller_Digits=12, Scroller_Prefix=" ", Scroller_Radix=2, Scroller_Value=0)  # disabled
curve_25 = Curve(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)  # disabled
curve_26 = Curve(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)  # disabled

digit_scroller_93 = DigitScroller(Scroller_Digits=12, Scroller_Prefix="Digit Scroller", Scroller_Radix=1, Scroller_Value=0.00140149998)  # disabled
number_slider_15 = Slider(256, range=0..65536)  # disabled

digit_scroller_94 = DigitScroller(Scroller_Digits=12, Scroller_Prefix="Digit Scroller", Scroller_Radix=1, Scroller_Value=0.00140149998)  # disabled
number_slider_16 = Slider(256, range=0..65536)  # disabled

digit_scroller_95 = DigitScroller(Scroller_Digits=12, Scroller_Prefix=" ", Scroller_Radix=7, Scroller_Value=16)  # disabled

vector_xyz_7 = VectorXYZ(XComponent=10, YComponent=4, ZComponent=0)  # -> Vector, Length; disabled

digit_scroller_96 = DigitScroller(Scroller_Digits=12, Scroller_Prefix=" ", Scroller_Radix=7, Scroller_Value=16)  # disabled

number_slider_17 = Slider(1, range=0..1)  # disabled

number_slider_18 = Slider(1, range=0..1)  # disabled

curve_27 = Curve(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)  # disabled

curve_28 = Curve(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)  # disabled

number_slider_19 = Slider(0, range=0..1)  # disabled
button_4 = Button()  # disabled
file_path_4 = FilePath("C:\VSC.O____EPAHS_LANGIS____STNEMGES_4201____HTOMS_LEVEL_3_DIOMGIS_ERUTAWRUC_RAENIL_DEPAM_SEMIT_4_NOITISNART_EGDE_LUF____O____FUL_EDGE_TRANSITION_4_TIMES_MAPED_LINEAR_CURWATURE_SIGMOID_3_LEVEL_SMOTH____1024_SEGMENTS____SIGNAL_SHAPE____O.CSV")  # disabled

vector_xyz_8 = VectorXYZ(XComponent=10, YComponent=1.5, ZComponent=0)  # -> Vector, Length; disabled

digit_scroller_97 = DigitScroller(Scroller_Digits=12, Scroller_Prefix=" ", Scroller_Radix=2, Scroller_Value=0)  # disabled
curve_29 = Curve(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)  # disabled
curve_30 = Curve(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)  # disabled

digit_scroller_98 = DigitScroller(Scroller_Digits=12, Scroller_Prefix="Digit Scroller", Scroller_Radix=1, Scroller_Value=0.00140149998)  # disabled
number_slider_20 = Slider(256, range=0..65536)  # disabled

digit_scroller_99 = DigitScroller(Scroller_Digits=12, Scroller_Prefix=" ", Scroller_Radix=7, Scroller_Value=16)  # disabled

number_slider_21 = Slider(1, range=0..1)  # disabled

curve_31 = Curve(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)  # disabled

digit_scroller_100 = DigitScroller(Scroller_Digits=12, Scroller_Prefix=" ", Scroller_Radix=1, Scroller_Value=2.1243e-06)
digit_scroller_101 = DigitScroller(Scroller_Digits=12, Scroller_Prefix=" ", Scroller_Radix=1, Scroller_Value=1)
digit_scroller_102 = DigitScroller(Scroller_Digits=12, Scroller_Prefix=" ", Scroller_Radix=11, Scroller_Value=4)
number_slider_22 = Slider(1, range=0..1)
number_slider_23 = Slider(1, range=0..1)
number_3 = Number(digit_scroller_100)

number_4 = Number(digit_scroller_102)  # disabled

radians = Radians(Degrees=number_3)

number_5 = Number(digit_scroller_102)

number_6 = Number(number_5)
number_7 = Number(number_5)
number_8 = Number(expr("X*4", number_7))

number_9 = Number(number_8)  # disabled

divide_curve = DivideCurve(Curve=line_sdl_2, Count=number_9, Kinks=False)  # -> Points, Tangents, Parameters; disabled

series_2 = Series(Start=0, Step=radians, Count=number_5)

expression_2 = Expression(O=series_2, Expression="FORMAT(\"{0:R}\",O)")
panel_81 = Panel(expression_2)

number_10 = Number(digit_scroller_101)
expression_3 = Expression(X=number_5, O=number_10, Expression="X^O")

duplicate_data = DuplicateData(Data=expression_3, Number=number_5, Order=True)
turtle = DotNETVBScriptLEGACY(Forward=duplicate_data, Left=series_2)  # -> Output, Points; inputs Forward: list, Left: list
# ---------- turtle: VB ----------
    Dim i As Integer
    Dim dir As New On3dVector(1, 0, 0)    
    Dim pos As New On3dVector(0, 0, 0) 
    Dim axis As New On3dVector(0, 0, 1)
    Dim pnts As New List(Of On3dVector)

    pnts.Add(pos)
    
    For i = 0 To Forward.Count() - 1
      Dim P As New On3dVector
      dir.Rotate(Left(i), axis)      
      P = dir * Forward(i) + pnts(i)
      pnts.Add(P)
    Next
    
    Points = pnts
# ---------- end turtle ----------
point = Point(turtle.Points)

scale = Scale(Geometry=point, Center=Point(0, 0, 0), Factor=expr("2^X", digit_scroller_47))  # -> Geometry, Transform

interpolate_t = InterpolateT(Vertices=scale.Geometry, TangentStart=Vector(0.0625, 0, 0), TangentEnd=Vector(0, 0, 0), KnotStyle=2)  # -> Curve, Length, Domain
evaluate_length = EvaluateLength(Curve=interpolate_t.Curve, Length=1, Normalized=True)  # -> Point, Tangent, Parameter
line_sdl_4 = LineSDL(Start=evaluate_length.Point, Direction=evaluate_length.Tangent, Length=1)
mirror = Mirror(Geometry=interpolate_t.Curve, Plane=line_sdl_4)  # -> Geometry, Transform
join_curves = JoinCurves(Curves=[interpolate_t.Curve, mirror.Geometry], Preserve=False)
evaluate_length_2 = EvaluateLength(Curve=join_curves, Length=1, Normalized=True)  # -> Point, Tangent, Parameter
rotate = Rotate(Geometry=join_curves, Angle=3.141592654, Plane=evaluate_length_2.Point)  # -> Geometry, Transform
join_curves_2 = JoinCurves(Curves=[join_curves, rotate.Geometry], Preserve=False)
curve_32 = Curve(join_curves_2)

expression_4 = Expression(O=turtle.Points, Expression="FORMAT(\"{0:R}\",O)")
evaluate_length_3 = EvaluateLength(Curve=join_curves_2, Length=1, Normalized=True)  # -> Point, Tangent, Parameter
deconstruct = Deconstruct(Point=evaluate_length_3.Point)  # -> XComponent, YComponent, ZComponent
expression_5 = Expression(O=deconstruct.YComponent, Expression="FORMAT(\"{0:R}\",O)")
expression_6 = Expression(O=deconstruct.XComponent, Expression="FORMAT(\"{0:R}\",O)")
expression_7 = Expression(O=deconstruct.ZComponent, Expression="FORMAT(\"{0:R}\",O)")
panel_82 = Panel(expression_5)
panel_83 = Panel(expression_6)
panel_84 = Panel(expression_7)
addition = Addition(A=panel_82, B=panel_83)
expression_8 = Expression(O=addition, Expression="FORMAT(\"{0:R}\",O)")
panel_85 = Panel(expression_8)
division = Division(A=panel_85, B=2)
expression_9 = Expression(O=division, Expression="FORMAT(\"{0:R}\",O)")
panel_86 = Panel(expression_9)
scale_2 = Scale(Geometry=curve_32, Center=Point(0, 0, 0), Factor=expr("1/X", panel_86))  # -> Geometry, Transform
evaluate_length_4 = EvaluateLength(Curve=scale_2.Geometry, Length=1, Normalized=True)  # -> Point, Tangent, Parameter
deconstruct_2 = Deconstruct(Point=evaluate_length_4.Point)  # -> XComponent, YComponent, ZComponent
expression_10 = Expression(O=deconstruct_2.XComponent, Expression="FORMAT(\"{0:R}\",O)")
expression_11 = Expression(O=deconstruct_2.ZComponent, Expression="FORMAT(\"{0:R}\",O)")
expression_12 = Expression(O=deconstruct_2.YComponent, Expression="FORMAT(\"{0:R}\",O)")
panel_87 = Panel(expression_11)
panel_88 = Panel(expression_12)
panel_89 = Panel(expression_10)
division_2 = Division(A=panel_83, B=panel_82)
expression_13 = Expression(O=division_2, Expression="FORMAT(\"{0:R}\",O)")
panel_90 = Panel(expression_13)
curve_33 = Curve(scale_2.Geometry)

panel_92 = Panel(expression_4)

move = Move(Geometry=curve_33, Motion=Vector(0, 0, 0))  # -> Geometry, Transform; disabled
curve_34 = Curve(move.Geometry)  # disabled

curve_35 = Curve(curve_33)
end_points = EndPoints(Curve=curve_35)  # -> Start, End
rectangle_2pt = Rectangle2Pt(Plane=PlaneXY(0, 0, 0), PointA=end_points.Start, PointB=end_points.End, Radius=0)  # -> Rectangle, Length
deconstuct_rectangle = DeconstuctRectangle(Rectangle=rectangle_2pt.Rectangle)  # -> BasePlane, XInterval, YInterval
deconstruct_domain = DeconstructDomain(Domain=deconstuct_rectangle.YInterval)  # -> Start, End
deconstruct_domain_2 = DeconstructDomain(Domain=deconstuct_rectangle.XInterval)  # -> Start, End
scale_nu = ScaleNU(
    Geometry=curve_33,
    Plane=PlaneXY(0, 0, 0),
    ScaleX=expr("1/X", deconstruct_domain_2.End),
    ScaleY=expr("1/X", deconstruct_domain.End),
    ScaleZ=1)  # -> Geometry, Transform
curve_36 = Curve(scale_nu.Geometry)

stream_filter = StreamFilter(Gate=number_slider_22, Stream0=curve_33, Stream1=curve_36)  # disabled
curve_37 = Curve(stream_filter)  # disabled
scale_3 = Scale(Geometry=curve_37, Center=Point(0, 0, 0), Factor=expr("2^X", number))  # -> Geometry, Transform; disabled
curve_38 = Curve(scale_3.Geometry)  # disabled

move_2 = Move(Geometry=curve_36, Motion=Vector(0, 1.5, 0))  # -> Geometry, Transform
curve_39 = Curve(move_2.Geometry)

stream_filter_2 = StreamFilter(Gate=number_slider_22, Stream0=curve_33, Stream1=curve_36)
curve_40 = Curve(stream_filter_2)
scale_4 = Scale(Geometry=curve_40, Center=Point(0, 0, 0), Factor=expr("2^X", number))  # -> Geometry, Transform
curve_41 = Curve(scale_4.Geometry)

end_points_2 = EndPoints(Curve=curve_38)  # -> Start, End; disabled
rectangle_2pt_2 = Rectangle2Pt(Plane=PlaneXY(0, 0, 0), PointA=end_points_2.Start, PointB=end_points_2.End, Radius=0)  # -> Rectangle, Length; disabled

number_11 = Number(digit_scroller_101)  # disabled

number_12 = Number(number_5)  # disabled

expression_14 = Expression(X=number_12, O=number_11, Expression="X^O")  # disabled
duplicate_data_2 = DuplicateData(Data=expression_14, Number=number_12, Order=True)  # disabled

radians_2 = Radians(Degrees=number_3)
number_13 = Number(digit_scroller_101)

expression_15 = Expression(O=radians_2, Expression="FORMAT(\"{0:0.00000000000000000000}\",O)")
panel_93 = Panel(expression_15)
number_14 = Number(number_5)

number_15 = Number(number_8)  # disabled
number_16 = Number(number_15)  # disabled

end_points_3 = EndPoints(Curve=curve_41)  # -> Start, End
rectangle_2pt_3 = Rectangle2Pt(Plane=PlaneXY(0, 0, 0), PointA=end_points_3.Start, PointB=end_points_3.End, Radius=0)  # -> Rectangle, Length

series_3 = Series(Start=0, Step=panel_93, Count=number_14)
expression_16 = Expression(O=series_3, Expression="FORMAT(\"{0:R}\",O)")
panel_94 = Panel(expression_16)
bounds = Bounds(Numbers=series_3)
expression_17 = Expression(X=number_14, O=number_13, Expression="X^O")
duplicate_data_3 = DuplicateData(Data=expression_17, Number=number_14, Order=True)

curve_graph_mapper = CurveGraphMapper(Curves=curve_41, Rectangle=rectangle_2pt_3.Rectangle, Values=series_3, Flip=False, Snap=True, TextSize=0.015625)  # -> Mapped, GraphCurves, GraphPoints, ValueLines, ValuePoints, MappedLines, MappedPoints, Boundary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; disabled
graphmapper = GraphMapper(Curve=curve_41, Boundary=rectangle_2pt_3.Rectangle, Numbers=series_3, Input=bounds, Output=bounds, bobo=True)
stream_filter_3 = StreamFilter(Gate=number_slider_23, Stream0=curve_graph_mapper.Mapped, Stream1=graphmapper)

turtle_2 = DotNETVBScriptLEGACY(Forward=duplicate_data_3, Left=stream_filter_3)  # -> Output, Points; inputs Forward: list, Left: list; same code as turtle

expression_18 = Expression(O=turtle_2.Points, Expression="FORMAT(\"{0:R}\",O)")
panel_95 = Panel(expression_18)

point_2 = Point(turtle_2.Points)
scale_5 = Scale(Geometry=point_2, Center=Point(0, 0, 0), Factor=expr("2^X", digit_scroller_63))  # -> Geometry, Transform

interpolate_t_2 = InterpolateT(Vertices=scale_5.Geometry, TangentStart=Vector(0.0625, 0, 0), TangentEnd=Vector(0, 0, 0), KnotStyle=2)  # -> Curve, Length, Domain
evaluate_length_5 = EvaluateLength(Curve=interpolate_t_2.Curve, Length=1, Normalized=True)  # -> Point, Tangent, Parameter
line_sdl_5 = LineSDL(Start=evaluate_length_5.Point, Direction=evaluate_length_5.Tangent, Length=1)
mirror_2 = Mirror(Geometry=interpolate_t_2.Curve, Plane=line_sdl_5)  # -> Geometry, Transform
join_curves_3 = JoinCurves(Curves=[interpolate_t_2.Curve, mirror_2.Geometry], Preserve=False)
evaluate_length_6 = EvaluateLength(Curve=join_curves_3, Length=1, Normalized=True)  # -> Point, Tangent, Parameter
rotate_2 = Rotate(Geometry=join_curves_3, Angle=3.141592654, Plane=evaluate_length_6.Point)  # -> Geometry, Transform
join_curves_4 = JoinCurves(Curves=[join_curves_3, rotate_2.Geometry], Preserve=False)
curve_42 = Curve(join_curves_4)

evaluate_length_7 = EvaluateLength(Curve=join_curves_4, Length=1, Normalized=True)  # -> Point, Tangent, Parameter
deconstruct_3 = Deconstruct(Point=evaluate_length_7.Point)  # -> XComponent, YComponent, ZComponent
expression_19 = Expression(O=deconstruct_3.YComponent, Expression="FORMAT(\"{0:R}\",O)")
expression_20 = Expression(O=deconstruct_3.XComponent, Expression="FORMAT(\"{0:R}\",O)")
expression_21 = Expression(O=deconstruct_3.ZComponent, Expression="FORMAT(\"{0:R}\",O)")
panel_96 = Panel(expression_19)
panel_97 = Panel(expression_20)
panel_98 = Panel(expression_21)
addition_2 = Addition(A=panel_96, B=panel_97)
expression_22 = Expression(O=addition_2, Expression="FORMAT(\"{0:R}\",O)")
panel_99 = Panel(expression_22)
division_3 = Division(A=panel_99, B=2)
expression_23 = Expression(O=division_3, Expression="FORMAT(\"{0:R}\",O)")
panel_100 = Panel(expression_23)
scale_6 = Scale(Geometry=scale_5.Geometry, Center=Point(0, 0, 0), Factor=expr("1/X", panel_100))  # -> Geometry, Transform
scale_7 = Scale(Geometry=curve_42, Center=Point(0, 0, 0), Factor=expr("1/X", panel_100))  # -> Geometry, Transform
evaluate_length_8 = EvaluateLength(Curve=scale_7.Geometry, Length=1, Normalized=True)  # -> Point, Tangent, Parameter
deconstruct_4 = Deconstruct(Point=evaluate_length_8.Point)  # -> XComponent, YComponent, ZComponent
expression_24 = Expression(O=deconstruct_4.YComponent, Expression="FORMAT(\"{0:R}\",O)")
expression_25 = Expression(O=deconstruct_4.XComponent, Expression="FORMAT(\"{0:R}\",O)")
expression_26 = Expression(O=deconstruct_4.ZComponent, Expression="FORMAT(\"{0:R}\",O)")
panel_101 = Panel(expression_24)
panel_102 = Panel(expression_25)
panel_103 = Panel(expression_26)
division_4 = Division(A=panel_97, B=panel_96)
expression_27 = Expression(O=division_4, Expression="FORMAT(\"{0:R}\",O)")
panel_104 = Panel(expression_27)
curve_43 = Curve(scale_7.Geometry)
point_3 = Point(scale_6.Geometry)

move_3 = Move(Geometry=curve_43, Motion=Vector(2.5, 0, 0))  # -> Geometry, Transform; disabled
mirror_3 = Mirror(Geometry=curve_43, Plane=PlaneYZ(0, 0, 0))  # -> Geometry, Transform; disabled
curve_44 = Curve(move_3.Geometry)  # disabled

curve_45 = Curve(curve_43)
end_points_4 = EndPoints(Curve=curve_45)  # -> Start, End
rectangle_2pt_4 = Rectangle2Pt(Plane=PlaneXY(0, 0, 0), PointA=end_points_4.Start, PointB=end_points_4.End, Radius=0)  # -> Rectangle, Length
deconstuct_rectangle_2 = DeconstuctRectangle(Rectangle=rectangle_2pt_4.Rectangle)  # -> BasePlane, XInterval, YInterval
deconstruct_domain_3 = DeconstructDomain(Domain=deconstuct_rectangle_2.YInterval)  # -> Start, End
deconstruct_domain_4 = DeconstructDomain(Domain=deconstuct_rectangle_2.XInterval)  # -> Start, End
scale_nu_2 = ScaleNU(
    Geometry=curve_43,
    Plane=PlaneXY(0, 0, 0),
    ScaleX=expr("1/X", deconstruct_domain_4.End),
    ScaleY=expr("1/X", deconstruct_domain_3.End),
    ScaleZ=1)  # -> Geometry, Transform
curve_46 = Curve(scale_nu_2.Geometry)
move_4 = Move(Geometry=curve_46, Motion=Vector(2.5, 1.5, 0))  # -> Geometry, Transform
curve_47 = Curve(move_4.Geometry)

stream_filter_4 = StreamFilter(Gate=number_slider_22, Stream0=curve_43, Stream1=curve_46)
curve_48 = Curve(stream_filter_4)
scale_8 = Scale(Geometry=curve_48, Center=Point(0, 0, 0), Factor=expr("2^X", number))  # -> Geometry, Transform
curve_49 = Curve(scale_8.Geometry)

stream_filter_5 = StreamFilter(Gate=number_slider_22, Stream0=curve_43, Stream1=curve_46)  # disabled
curve_50 = Curve(stream_filter_5)  # disabled
scale_9 = Scale(Geometry=curve_50, Center=Point(0, 0, 0), Factor=expr("2^X", number))  # -> Geometry, Transform; disabled
curve_51 = Curve(scale_9.Geometry)  # disabled

end_points_5 = EndPoints(Curve=curve_49)  # -> Start, End
rectangle_2pt_5 = Rectangle2Pt(Plane=PlaneXY(0, 0, 0), PointA=end_points_5.Start, PointB=end_points_5.End, Radius=0)  # -> Rectangle, Length

number_17 = Number(digit_scroller_101)

number_18 = Number(number_5)

expression_28 = Expression(X=number_18, O=number_17, Expression="X^O")
duplicate_data_4 = DuplicateData(Data=expression_28, Number=number_18, Order=True)

radians_3 = Radians(Degrees=number_3)  # disabled
number_19 = Number(digit_scroller_101)  # disabled

expression_29 = Expression(O=radians_3, Expression="FORMAT(\"{0:0.00000000000000000000}\",O)")  # disabled
panel_106 = Panel(expression_29)  # disabled
number_20 = Number(number_5)  # disabled

end_points_6 = EndPoints(Curve=curve_51)  # -> Start, End; disabled
rectangle_2pt_6 = Rectangle2Pt(Plane=PlaneXY(0, 0, 0), PointA=end_points_6.Start, PointB=end_points_6.End, Radius=0)  # -> Rectangle, Length; disabled

series_4 = Series(Start=0, Step=panel_106, Count=number_20)  # disabled
expression_30 = Expression(O=series_4, Expression="FORMAT(\"{0:R}\",O)")  # disabled
panel_107 = Panel(expression_30)  # disabled
bounds_2 = Bounds(Numbers=series_4)  # disabled
expression_31 = Expression(X=number_20, O=number_19, Expression="X^O")  # disabled
duplicate_data_5 = DuplicateData(Data=expression_31, Number=number_20, Order=True)  # disabled

curve_graph_mapper_2 = CurveGraphMapper(Curves=curve_51, Rectangle=rectangle_2pt_6.Rectangle, Values=series_4, Flip=False, Snap=True, TextSize=0.015625)  # -> Mapped, GraphCurves, GraphPoints, ValueLines, ValuePoints, MappedLines, MappedPoints, Boundary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; disabled
graphmapper_2 = GraphMapper(Curve=curve_51, Boundary=rectangle_2pt_6.Rectangle, Numbers=series_4, Input=bounds_2, Output=bounds_2, bobo=True)  # disabled
stream_filter_6 = StreamFilter(Gate=number_slider_23, Stream0=curve_graph_mapper_2.Mapped, Stream1=graphmapper_2)  # disabled

turtle_3 = DotNETVBScriptLEGACY(Forward=duplicate_data_5, Left=stream_filter_6)  # -> Output, Points; inputs Forward: list, Left: list; disabled; same code as turtle

expression_32 = Expression(O=turtle_3.Points, Expression="FORMAT(\"{0:R}\",O)")  # disabled
panel_108 = Panel(expression_32)  # disabled

point_4 = Point(turtle_3.Points)  # disabled
scale_10 = Scale(Geometry=point_4, Center=Point(0, 0, 0), Factor=expr("2^X", digit_scroller_70))  # -> Geometry, Transform; disabled

interpolate_t_3 = InterpolateT(Vertices=scale_10.Geometry, TangentStart=Vector(0.0625, 0, 0), TangentEnd=Vector(0, 0, 0), KnotStyle=2)  # -> Curve, Length, Domain; disabled
evaluate_length_9 = EvaluateLength(Curve=interpolate_t_3.Curve, Length=1, Normalized=True)  # -> Point, Tangent, Parameter; disabled
line_sdl_6 = LineSDL(Start=evaluate_length_9.Point, Direction=evaluate_length_9.Tangent, Length=1)  # disabled
mirror_4 = Mirror(Geometry=interpolate_t_3.Curve, Plane=line_sdl_6)  # -> Geometry, Transform; disabled
join_curves_5 = JoinCurves(Curves=[interpolate_t_3.Curve, mirror_4.Geometry], Preserve=False)  # disabled
evaluate_length_10 = EvaluateLength(Curve=join_curves_5, Length=1, Normalized=True)  # -> Point, Tangent, Parameter; disabled
rotate_3 = Rotate(Geometry=join_curves_5, Angle=3.141592654, Plane=evaluate_length_10.Point)  # -> Geometry, Transform; disabled
join_curves_6 = JoinCurves(Curves=[join_curves_5, rotate_3.Geometry], Preserve=False)  # disabled
curve_52 = Curve(join_curves_6)  # disabled

evaluate_length_11 = EvaluateLength(Curve=join_curves_6, Length=1, Normalized=True)  # -> Point, Tangent, Parameter; disabled
deconstruct_5 = Deconstruct(Point=evaluate_length_11.Point)  # -> XComponent, YComponent, ZComponent; disabled
expression_33 = Expression(O=deconstruct_5.YComponent, Expression="FORMAT(\"{0:R}\",O)")  # disabled
expression_34 = Expression(O=deconstruct_5.XComponent, Expression="FORMAT(\"{0:R}\",O)")  # disabled
expression_35 = Expression(O=deconstruct_5.ZComponent, Expression="FORMAT(\"{0:R}\",O)")  # disabled
panel_109 = Panel(expression_33)  # disabled
panel_110 = Panel(expression_34)  # disabled
panel_111 = Panel(expression_35)  # disabled
addition_3 = Addition(A=panel_109, B=panel_110)  # disabled
expression_36 = Expression(O=addition_3, Expression="FORMAT(\"{0:R}\",O)")  # disabled
panel_112 = Panel(expression_36)  # disabled
division_5 = Division(A=panel_112, B=2)  # disabled
expression_37 = Expression(O=division_5, Expression="FORMAT(\"{0:R}\",O)")  # disabled
panel_113 = Panel(expression_37)  # disabled
scale_11 = Scale(Geometry=scale_10.Geometry, Center=Point(0, 0, 0), Factor=expr("1/X", panel_113))  # -> Geometry, Transform; disabled
scale_12 = Scale(Geometry=curve_52, Center=Point(0, 0, 0), Factor=expr("1/X", panel_113))  # -> Geometry, Transform; disabled
evaluate_length_12 = EvaluateLength(Curve=scale_12.Geometry, Length=1, Normalized=True)  # -> Point, Tangent, Parameter; disabled
deconstruct_6 = Deconstruct(Point=evaluate_length_12.Point)  # -> XComponent, YComponent, ZComponent; disabled
expression_38 = Expression(O=deconstruct_6.YComponent, Expression="FORMAT(\"{0:R}\",O)")  # disabled
expression_39 = Expression(O=deconstruct_6.XComponent, Expression="FORMAT(\"{0:R}\",O)")  # disabled
expression_40 = Expression(O=deconstruct_6.ZComponent, Expression="FORMAT(\"{0:R}\",O)")  # disabled
panel_114 = Panel(expression_38)  # disabled
panel_115 = Panel(expression_39)  # disabled
panel_116 = Panel(expression_40)  # disabled
division_6 = Division(A=panel_110, B=panel_109)  # disabled
expression_41 = Expression(O=division_6, Expression="FORMAT(\"{0:R}\",O)")  # disabled
panel_117 = Panel(expression_41)  # disabled
curve_53 = Curve(scale_12.Geometry)  # disabled
point_5 = Point(scale_11.Geometry)  # disabled

move_5 = Move(Geometry=curve_53, Motion=Vector(5, 0, 0))  # -> Geometry, Transform; disabled
mirror_5 = Mirror(Geometry=curve_53, Plane=PlaneYZ(0, 0, 0))  # -> Geometry, Transform; disabled
curve_54 = Curve(move_5.Geometry)  # disabled

curve_55 = Curve(curve_53)  # disabled
end_points_7 = EndPoints(Curve=curve_55)  # -> Start, End; disabled
rectangle_2pt_7 = Rectangle2Pt(Plane=PlaneXY(0, 0, 0), PointA=end_points_7.Start, PointB=end_points_7.End, Radius=0)  # -> Rectangle, Length; disabled
deconstuct_rectangle_3 = DeconstuctRectangle(Rectangle=rectangle_2pt_7.Rectangle)  # -> BasePlane, XInterval, YInterval; disabled
deconstruct_domain_5 = DeconstructDomain(Domain=deconstuct_rectangle_3.YInterval)  # -> Start, End; disabled
deconstruct_domain_6 = DeconstructDomain(Domain=deconstuct_rectangle_3.XInterval)  # -> Start, End; disabled
scale_nu_3 = ScaleNU(
    Geometry=curve_53,
    Plane=PlaneXY(0, 0, 0),
    ScaleX=expr("1/X", deconstruct_domain_6.End),
    ScaleY=expr("1/X", deconstruct_domain_5.End),
    ScaleZ=1)  # -> Geometry, Transform; disabled
curve_56 = Curve(scale_nu_3.Geometry)  # disabled
move_6 = Move(Geometry=curve_56, Motion=vector_xyz_4.Vector)  # -> Geometry, Transform; disabled
curve_57 = Curve(move_6.Geometry)  # disabled

stream_filter_7 = StreamFilter(Gate=number_slider_22, Stream0=curve_53, Stream1=curve_56)  # disabled
curve_58 = Curve(stream_filter_7)  # disabled
scale_13 = Scale(Geometry=curve_58, Center=Point(0, 0, 0), Factor=expr("2^X", number))  # -> Geometry, Transform; disabled
curve_59 = Curve(scale_13.Geometry)  # disabled

stream_filter_8 = StreamFilter(Gate=number_slider_22, Stream0=curve_53, Stream1=curve_56)  # disabled
curve_60 = Curve(stream_filter_8)  # disabled
scale_14 = Scale(Geometry=curve_60, Center=Point(0, 0, 0), Factor=expr("2^X", number))  # -> Geometry, Transform; disabled
curve_61 = Curve(scale_14.Geometry)  # disabled

end_points_8 = EndPoints(Curve=curve_59)  # -> Start, End; disabled
rectangle_2pt_8 = Rectangle2Pt(Plane=PlaneXY(0, 0, 0), PointA=end_points_8.Start, PointB=end_points_8.End, Radius=0)  # -> Rectangle, Length; disabled

number_21 = Number(number_5)  # disabled

number_22 = Number(digit_scroller_101)  # disabled
expression_42 = Expression(X=number_21, O=number_22, Expression="X^O")  # disabled
duplicate_data_6 = DuplicateData(Data=expression_42, Number=number_21, Order=True)  # disabled

number_23 = Number(number_8)
number_24 = Number(number_23)

number_25 = Number(number_23)  # disabled

radians_4 = Radians(Degrees=number_3)  # disabled
number_26 = Number(digit_scroller_101)  # disabled

expression_43 = Expression(O=radians_4, Expression="FORMAT(\"{0:0.00000000000000000000}\",O)")  # disabled
panel_119 = Panel(expression_43)  # disabled
number_27 = Number(number_5)  # disabled

end_points_9 = EndPoints(Curve=curve_61)  # -> Start, End; disabled
rectangle_2pt_9 = Rectangle2Pt(Plane=PlaneXY(0, 0, 0), PointA=end_points_9.Start, PointB=end_points_9.End, Radius=0)  # -> Rectangle, Length; disabled

series_5 = Series(Start=0, Step=panel_119, Count=number_27)  # disabled
expression_44 = Expression(O=series_5, Expression="FORMAT(\"{0:R}\",O)")  # disabled
panel_120 = Panel(expression_44)  # disabled
bounds_3 = Bounds(Numbers=series_5)  # disabled
expression_45 = Expression(X=number_27, O=number_26, Expression="X^O")  # disabled
duplicate_data_7 = DuplicateData(Data=expression_45, Number=number_27, Order=True)  # disabled

curve_graph_mapper_3 = CurveGraphMapper(Curves=curve_61, Rectangle=rectangle_2pt_9.Rectangle, Values=series_5, Flip=False, Snap=True, TextSize=0.015625)  # -> Mapped, GraphCurves, GraphPoints, ValueLines, ValuePoints, MappedLines, MappedPoints, Boundary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; disabled
graphmapper_3 = GraphMapper(Curve=curve_61, Boundary=rectangle_2pt_9.Rectangle, Numbers=series_5, Input=bounds_3, Output=bounds_3, bobo=True)  # disabled
stream_filter_9 = StreamFilter(Gate=number_slider_23, Stream0=curve_graph_mapper_3.Mapped, Stream1=graphmapper_3)  # disabled

turtle_4 = DotNETVBScriptLEGACY(Forward=duplicate_data_7, Left=stream_filter_9)  # -> Output, Points; inputs Forward: list, Left: list; disabled; same code as turtle

expression_46 = Expression(O=turtle_4.Points, Expression="FORMAT(\"{0:R}\",O)")  # disabled
panel_121 = Panel(expression_46)  # disabled

point_6 = Point(turtle_4.Points)  # disabled
scale_15 = Scale(Geometry=point_6, Center=Point(0, 0, 0), Factor=expr("2^X", digit_scroller_87))  # -> Geometry, Transform; disabled

interpolate_t_4 = InterpolateT(Vertices=scale_15.Geometry, TangentStart=Vector(0.0625, 0, 0), TangentEnd=Vector(0, 0, 0), KnotStyle=2)  # -> Curve, Length, Domain; disabled
evaluate_length_13 = EvaluateLength(Curve=interpolate_t_4.Curve, Length=1, Normalized=True)  # -> Point, Tangent, Parameter; disabled
line_sdl_7 = LineSDL(Start=evaluate_length_13.Point, Direction=evaluate_length_13.Tangent, Length=1)  # disabled
mirror_6 = Mirror(Geometry=interpolate_t_4.Curve, Plane=line_sdl_7)  # -> Geometry, Transform; disabled
join_curves_7 = JoinCurves(Curves=[interpolate_t_4.Curve, mirror_6.Geometry], Preserve=False)  # disabled
evaluate_length_14 = EvaluateLength(Curve=join_curves_7, Length=1, Normalized=True)  # -> Point, Tangent, Parameter; disabled
rotate_4 = Rotate(Geometry=join_curves_7, Angle=3.141592654, Plane=evaluate_length_14.Point)  # -> Geometry, Transform; disabled
join_curves_8 = JoinCurves(Curves=[join_curves_7, rotate_4.Geometry], Preserve=False)  # disabled
curve_62 = Curve(join_curves_8)  # disabled

evaluate_length_15 = EvaluateLength(Curve=join_curves_8, Length=1, Normalized=True)  # -> Point, Tangent, Parameter; disabled
deconstruct_7 = Deconstruct(Point=evaluate_length_15.Point)  # -> XComponent, YComponent, ZComponent; disabled
expression_47 = Expression(O=deconstruct_7.YComponent, Expression="FORMAT(\"{0:R}\",O)")  # disabled
expression_48 = Expression(O=deconstruct_7.XComponent, Expression="FORMAT(\"{0:R}\",O)")  # disabled
expression_49 = Expression(O=deconstruct_7.ZComponent, Expression="FORMAT(\"{0:R}\",O)")  # disabled
panel_122 = Panel(expression_47)  # disabled
panel_123 = Panel(expression_48)  # disabled
panel_124 = Panel(expression_49)  # disabled
addition_4 = Addition(A=panel_122, B=panel_123)  # disabled
expression_50 = Expression(O=addition_4, Expression="FORMAT(\"{0:R}\",O)")  # disabled
panel_125 = Panel(expression_50)  # disabled
division_7 = Division(A=panel_125, B=2)  # disabled
expression_51 = Expression(O=division_7, Expression="FORMAT(\"{0:R}\",O)")  # disabled
panel_126 = Panel(expression_51)  # disabled
scale_16 = Scale(Geometry=scale_15.Geometry, Center=Point(0, 0, 0), Factor=expr("1/X", panel_126))  # -> Geometry, Transform; disabled
scale_17 = Scale(Geometry=curve_62, Center=Point(0, 0, 0), Factor=expr("1/X", panel_126))  # -> Geometry, Transform; disabled
evaluate_length_16 = EvaluateLength(Curve=scale_17.Geometry, Length=1, Normalized=True)  # -> Point, Tangent, Parameter; disabled
deconstruct_8 = Deconstruct(Point=evaluate_length_16.Point)  # -> XComponent, YComponent, ZComponent; disabled
expression_52 = Expression(O=deconstruct_8.YComponent, Expression="FORMAT(\"{0:R}\",O)")  # disabled
expression_53 = Expression(O=deconstruct_8.XComponent, Expression="FORMAT(\"{0:R}\",O)")  # disabled
expression_54 = Expression(O=deconstruct_8.ZComponent, Expression="FORMAT(\"{0:R}\",O)")  # disabled
panel_127 = Panel(expression_52)  # disabled
panel_128 = Panel(expression_53)  # disabled
panel_129 = Panel(expression_54)  # disabled
division_8 = Division(A=panel_123, B=panel_122)  # disabled
expression_55 = Expression(O=division_8, Expression="FORMAT(\"{0:R}\",O)")  # disabled
panel_130 = Panel(expression_55)  # disabled
curve_63 = Curve(scale_17.Geometry)  # disabled
point_7 = Point(scale_16.Geometry)  # disabled

move_7 = Move(Geometry=curve_63, Motion=Vector(7.5, 0, 0))  # -> Geometry, Transform; disabled
mirror_7 = Mirror(Geometry=curve_63, Plane=PlaneYZ(0, 0, 0))  # -> Geometry, Transform; disabled
curve_64 = Curve(move_7.Geometry)  # disabled

curve_65 = Curve(curve_63)  # disabled
end_points_10 = EndPoints(Curve=curve_65)  # -> Start, End; disabled
rectangle_2pt_10 = Rectangle2Pt(Plane=PlaneXY(0, 0, 0), PointA=end_points_10.Start, PointB=end_points_10.End, Radius=0)  # -> Rectangle, Length; disabled
deconstuct_rectangle_4 = DeconstuctRectangle(Rectangle=rectangle_2pt_10.Rectangle)  # -> BasePlane, XInterval, YInterval; disabled
deconstruct_domain_7 = DeconstructDomain(Domain=deconstuct_rectangle_4.YInterval)  # -> Start, End; disabled
deconstruct_domain_8 = DeconstructDomain(Domain=deconstuct_rectangle_4.XInterval)  # -> Start, End; disabled
scale_nu_4 = ScaleNU(
    Geometry=curve_63,
    Plane=PlaneXY(0, 0, 0),
    ScaleX=expr("1/X", deconstruct_domain_8.End),
    ScaleY=expr("1/X", deconstruct_domain_7.End),
    ScaleZ=1)  # -> Geometry, Transform; disabled
curve_66 = Curve(scale_nu_4.Geometry)  # disabled
move_8 = Move(Geometry=curve_66, Motion=vector_xyz_6.Vector)  # -> Geometry, Transform; disabled
curve_67 = Curve(move_8.Geometry)  # disabled

stream_filter_10 = StreamFilter(Gate=number_slider_22, Stream0=curve_63, Stream1=curve_66)  # disabled
curve_68 = Curve(stream_filter_10)  # disabled
scale_18 = Scale(Geometry=curve_68, Center=Point(0, 0, 0), Factor=expr("2^X", number))  # -> Geometry, Transform; disabled
curve_69 = Curve(scale_18.Geometry)  # disabled

stream_filter_11 = StreamFilter(Gate=number_slider_22, Stream0=curve_63, Stream1=curve_66)  # disabled
curve_70 = Curve(stream_filter_11)  # disabled
scale_19 = Scale(Geometry=curve_70, Center=Point(0, 0, 0), Factor=expr("2^X", number))  # -> Geometry, Transform; disabled
curve_71 = Curve(scale_19.Geometry)  # disabled

end_points_11 = EndPoints(Curve=curve_69)  # -> Start, End; disabled
rectangle_2pt_11 = Rectangle2Pt(Plane=PlaneXY(0, 0, 0), PointA=end_points_11.Start, PointB=end_points_11.End, Radius=0)  # -> Rectangle, Length; disabled

number_28 = Number(number_5)  # disabled

number_29 = Number(digit_scroller_101)  # disabled
expression_56 = Expression(X=number_28, O=number_29, Expression="X^O")  # disabled
duplicate_data_8 = DuplicateData(Data=expression_56, Number=number_28, Order=True)  # disabled

number_30 = Number(expr("X*4", number_4))  # disabled
divide_curve_2 = DivideCurve(Curve=line_sdl_3, Count=expr("X/2", number_30), Kinks=False)  # -> Points, Tangents, Parameters; disabled
line_sdl_8 = LineSDL(Start=divide_curve_2.Points, Direction=Vector(0, 1, 0), Length=1)  # disabled
scale_20 = Scale(Geometry=line_sdl_8, Center=Point(0, 0, 0), Factor=expr("2^X", number_2))  # -> Geometry, Transform; disabled

number_31 = Number(expr("X*4", number_4))  # disabled

radians_5 = Radians(Degrees=number_3)  # disabled

expression_57 = Expression(O=radians_5, Expression="FORMAT(\"{0:0.00000000000000000000}\",O)")  # disabled
panel_132 = Panel(expression_57)  # disabled
number_32 = Number(number_5)  # disabled

end_points_12 = EndPoints(Curve=curve_71)  # -> Start, End; disabled
rectangle_2pt_12 = Rectangle2Pt(Plane=PlaneXY(0, 0, 0), PointA=end_points_12.Start, PointB=end_points_12.End, Radius=0)  # -> Rectangle, Length; disabled

series_6 = Series(Start=0, Step=panel_132, Count=number_32)  # disabled
expression_58 = Expression(O=series_6, Expression="FORMAT(\"{0:R}\",O)")  # disabled
panel_133 = Panel(expression_58)  # disabled
bounds_4 = Bounds(Numbers=series_6)  # disabled
expression_59 = Expression(X=number_32, Expression="X")  # disabled
duplicate_data_9 = DuplicateData(Data=expression_59, Number=number_32, Order=True)  # disabled

curve_graph_mapper_4 = CurveGraphMapper(Curves=curve_71, Rectangle=rectangle_2pt_12.Rectangle, Values=series_6, Flip=False, Snap=True, TextSize=0.015625)  # -> Mapped, GraphCurves, GraphPoints, ValueLines, ValuePoints, MappedLines, MappedPoints, Boundary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; disabled
graphmapper_4 = GraphMapper(Curve=curve_71, Boundary=rectangle_2pt_12.Rectangle, Numbers=series_6, Input=bounds_4, Output=bounds_4, bobo=True)  # disabled
stream_filter_12 = StreamFilter(Gate=number_slider_23, Stream0=curve_graph_mapper_4.Mapped, Stream1=graphmapper_4)  # disabled

turtle_5 = DotNETVBScriptLEGACY(Forward=duplicate_data_9, Left=stream_filter_12)  # -> Output, Points; inputs Forward: list, Left: list; disabled; same code as turtle

expression_60 = Expression(O=turtle_5.Points, Expression="FORMAT(\"{0:R}\",O)")  # disabled
panel_134 = Panel(expression_60)  # disabled

point_8 = Point(turtle_5.Points)  # disabled
scale_21 = Scale(Geometry=point_8, Center=Point(0, 0, 0), Factor=expr("2^X", digit_scroller_96))  # -> Geometry, Transform; disabled

interpolate_t_5 = InterpolateT(Vertices=scale_21.Geometry, TangentStart=Vector(0.0625, 0, 0), TangentEnd=Vector(0, 0, 0), KnotStyle=2)  # -> Curve, Length, Domain; disabled
evaluate_length_17 = EvaluateLength(Curve=interpolate_t_5.Curve, Length=1, Normalized=True)  # -> Point, Tangent, Parameter; disabled
line_sdl_9 = LineSDL(Start=evaluate_length_17.Point, Direction=evaluate_length_17.Tangent, Length=1)  # disabled
mirror_8 = Mirror(Geometry=interpolate_t_5.Curve, Plane=line_sdl_9)  # -> Geometry, Transform; disabled
join_curves_9 = JoinCurves(Curves=[interpolate_t_5.Curve, mirror_8.Geometry], Preserve=False)  # disabled
evaluate_length_18 = EvaluateLength(Curve=join_curves_9, Length=1, Normalized=True)  # -> Point, Tangent, Parameter; disabled
rotate_5 = Rotate(Geometry=join_curves_9, Angle=3.141592654, Plane=evaluate_length_18.Point)  # -> Geometry, Transform; disabled
join_curves_10 = JoinCurves(Curves=[join_curves_9, rotate_5.Geometry], Preserve=False)  # disabled
curve_72 = Curve(join_curves_10)  # disabled

evaluate_length_19 = EvaluateLength(Curve=join_curves_10, Length=1, Normalized=True)  # -> Point, Tangent, Parameter; disabled
deconstruct_9 = Deconstruct(Point=evaluate_length_19.Point)  # -> XComponent, YComponent, ZComponent; disabled
expression_61 = Expression(O=deconstruct_9.YComponent, Expression="FORMAT(\"{0:R}\",O)")  # disabled
expression_62 = Expression(O=deconstruct_9.XComponent, Expression="FORMAT(\"{0:R}\",O)")  # disabled
expression_63 = Expression(O=deconstruct_9.ZComponent, Expression="FORMAT(\"{0:R}\",O)")  # disabled
panel_135 = Panel(expression_61)  # disabled
panel_136 = Panel(expression_62)  # disabled
panel_137 = Panel(expression_63)  # disabled
addition_5 = Addition(A=panel_135, B=panel_136)  # disabled
expression_64 = Expression(O=addition_5, Expression="FORMAT(\"{0:R}\",O)")  # disabled
panel_138 = Panel(expression_64)  # disabled
division_9 = Division(A=panel_138, B=2)  # disabled
expression_65 = Expression(O=division_9, Expression="FORMAT(\"{0:R}\",O)")  # disabled
panel_139 = Panel(expression_65)  # disabled
scale_22 = Scale(Geometry=scale_21.Geometry, Center=Point(0, 0, 0), Factor=expr("1/X", panel_139))  # -> Geometry, Transform; disabled
scale_23 = Scale(Geometry=curve_72, Center=Point(0, 0, 0), Factor=expr("1/X", panel_139))  # -> Geometry, Transform; disabled
evaluate_length_20 = EvaluateLength(Curve=scale_23.Geometry, Length=1, Normalized=True)  # -> Point, Tangent, Parameter; disabled
deconstruct_10 = Deconstruct(Point=evaluate_length_20.Point)  # -> XComponent, YComponent, ZComponent; disabled
expression_66 = Expression(O=deconstruct_10.YComponent, Expression="FORMAT(\"{0:R}\",O)")  # disabled
expression_67 = Expression(O=deconstruct_10.XComponent, Expression="FORMAT(\"{0:R}\",O)")  # disabled
expression_68 = Expression(O=deconstruct_10.ZComponent, Expression="FORMAT(\"{0:R}\",O)")  # disabled
panel_140 = Panel(expression_66)  # disabled
panel_141 = Panel(expression_67)  # disabled
panel_142 = Panel(expression_68)  # disabled
division_10 = Division(A=panel_136, B=panel_135)  # disabled
expression_69 = Expression(O=division_10, Expression="FORMAT(\"{0:R}\",O)")  # disabled
panel_143 = Panel(expression_69)  # disabled
curve_73 = Curve(scale_23.Geometry)  # disabled
point_9 = Point(scale_22.Geometry)  # disabled

move_9 = Move(Geometry=curve_73, Motion=Vector(10, 0, 0))  # -> Geometry, Transform; disabled
mirror_9 = Mirror(Geometry=curve_73, Plane=PlaneYZ(0, 0, 0))  # -> Geometry, Transform; disabled
curve_74 = Curve(move_9.Geometry)  # disabled

curve_75 = Curve(curve_73)  # disabled
end_points_13 = EndPoints(Curve=curve_75)  # -> Start, End; disabled
rectangle_2pt_13 = Rectangle2Pt(Plane=PlaneXY(0, 0, 0), PointA=end_points_13.Start, PointB=end_points_13.End, Radius=0)  # -> Rectangle, Length; disabled
deconstuct_rectangle_5 = DeconstuctRectangle(Rectangle=rectangle_2pt_13.Rectangle)  # -> BasePlane, XInterval, YInterval; disabled
deconstruct_domain_9 = DeconstructDomain(Domain=deconstuct_rectangle_5.YInterval)  # -> Start, End; disabled
deconstruct_domain_10 = DeconstructDomain(Domain=deconstuct_rectangle_5.XInterval)  # -> Start, End; disabled
scale_nu_5 = ScaleNU(
    Geometry=curve_73,
    Plane=PlaneXY(0, 0, 0),
    ScaleX=expr("1/X", deconstruct_domain_10.End),
    ScaleY=expr("1/X", deconstruct_domain_9.End),
    ScaleZ=1)  # -> Geometry, Transform; disabled
curve_76 = Curve(scale_nu_5.Geometry)  # disabled
move_10 = Move(Geometry=curve_76, Motion=vector_xyz_8.Vector)  # -> Geometry, Transform; disabled
curve_77 = Curve(move_10.Geometry)  # disabled

stream_filter_13 = StreamFilter(Gate=number_slider_22, Stream0=curve_73, Stream1=curve_76)  # disabled
curve_78 = Curve(stream_filter_13)  # disabled
scale_24 = Scale(Geometry=curve_78, Center=Point(0, 0, 0), Factor=expr("2^X", number))  # -> Geometry, Transform; disabled
curve_79 = Curve(scale_24.Geometry)  # disabled

stream_filter_14 = StreamFilter(Gate=number_slider_22, Stream0=curve_73, Stream1=curve_76)  # disabled
curve_80 = Curve(stream_filter_14)  # disabled
scale_25 = Scale(Geometry=curve_80, Center=Point(0, 0, 0), Factor=expr("2^X", number))  # -> Geometry, Transform; disabled
curve_81 = Curve(scale_25.Geometry)  # disabled

end_points_14 = EndPoints(Curve=curve_79)  # -> Start, End; disabled
rectangle_2pt_14 = Rectangle2Pt(Plane=PlaneXY(0, 0, 0), PointA=end_points_14.Start, PointB=end_points_14.End, Radius=0)  # -> Rectangle, Length; disabled

number_33 = Number(number_5)  # disabled

expression_70 = Expression(X=number_33, Expression="1/X")  # disabled
duplicate_data_10 = DuplicateData(Data=expression_70, Number=number_33, Order=True)  # disabled

number_34 = Number(expr("X*4", number_4))  # disabled

radians_6 = Radians(Degrees=number_3)  # disabled

expression_71 = Expression(O=radians_6, Expression="FORMAT(\"{0:0.00000000000000000000}\",O)")  # disabled
panel_145 = Panel(expression_71)  # disabled
number_35 = Number(number_5)  # disabled

end_points_15 = EndPoints(Curve=curve_81)  # -> Start, End; disabled
rectangle_2pt_15 = Rectangle2Pt(Plane=PlaneXY(0, 0, 0), PointA=end_points_15.Start, PointB=end_points_15.End, Radius=0)  # -> Rectangle, Length; disabled

series_7 = Series(Start=0, Step=panel_145, Count=number_35)  # disabled
expression_72 = Expression(O=series_7, Expression="FORMAT(\"{0:R}\",O)")  # disabled
panel_146 = Panel(expression_72)  # disabled
bounds_5 = Bounds(Numbers=series_7)  # disabled
expression_73 = Expression(X=number_35, Expression="1/X")  # disabled
duplicate_data_11 = DuplicateData(Data=expression_73, Number=number_35, Order=True)  # disabled

curve_graph_mapper_5 = CurveGraphMapper(Curves=curve_81, Rectangle=rectangle_2pt_15.Rectangle, Values=series_7, Flip=False, Snap=True, TextSize=0.015625)  # -> Mapped, GraphCurves, GraphPoints, ValueLines, ValuePoints, MappedLines, MappedPoints, Boundary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; disabled
graphmapper_5 = GraphMapper(Curve=curve_81, Boundary=rectangle_2pt_15.Rectangle, Numbers=series_7, Input=bounds_5, Output=bounds_5, bobo=False)  # disabled
stream_filter_15 = StreamFilter(Gate=number_slider_23, Stream0=curve_graph_mapper_5.Mapped, Stream1=graphmapper_5)  # disabled

turtle_6 = DotNETVBScriptLEGACY(Forward=duplicate_data_11, Left=stream_filter_15)  # -> Output, Points; inputs Forward: list, Left: list; disabled; same code as turtle

expression_74 = Expression(O=turtle_6.Points, Expression="FORMAT(\"{0:R}\",O)")  # disabled
panel_147 = Panel(expression_74)  # disabled

point_10 = Point(turtle_6.Points)  # disabled
scale_26 = Scale(Geometry=point_10, Center=Point(0, 0, 0), Factor=expr("2^X", digit_scroller_99))  # -> Geometry, Transform; disabled

interpolate_t_6 = InterpolateT(Vertices=scale_26.Geometry, TangentStart=Vector(0.0625, 0, 0), TangentEnd=Vector(0, 0, 0), KnotStyle=2)  # -> Curve, Length, Domain; disabled
evaluate_length_21 = EvaluateLength(Curve=interpolate_t_6.Curve, Length=1, Normalized=True)  # -> Point, Tangent, Parameter; disabled
line_sdl_10 = LineSDL(Start=evaluate_length_21.Point, Direction=evaluate_length_21.Tangent, Length=1)  # disabled
mirror_10 = Mirror(Geometry=interpolate_t_6.Curve, Plane=line_sdl_10)  # -> Geometry, Transform; disabled
join_curves_11 = JoinCurves(Curves=[interpolate_t_6.Curve, mirror_10.Geometry], Preserve=False)  # disabled
evaluate_length_22 = EvaluateLength(Curve=join_curves_11, Length=1, Normalized=True)  # -> Point, Tangent, Parameter; disabled
rotate_6 = Rotate(Geometry=join_curves_11, Angle=3.141592654, Plane=evaluate_length_22.Point)  # -> Geometry, Transform; disabled
join_curves_12 = JoinCurves(Curves=[join_curves_11, rotate_6.Geometry], Preserve=False)  # disabled
curve_82 = Curve(join_curves_12)  # disabled

evaluate_length_23 = EvaluateLength(Curve=join_curves_12, Length=1, Normalized=True)  # -> Point, Tangent, Parameter; disabled
deconstruct_11 = Deconstruct(Point=evaluate_length_23.Point)  # -> XComponent, YComponent, ZComponent; disabled
expression_75 = Expression(O=deconstruct_11.YComponent, Expression="FORMAT(\"{0:R}\",O)")  # disabled
expression_76 = Expression(O=deconstruct_11.XComponent, Expression="FORMAT(\"{0:R}\",O)")  # disabled
expression_77 = Expression(O=deconstruct_11.ZComponent, Expression="FORMAT(\"{0:R}\",O)")  # disabled
panel_148 = Panel(expression_75)  # disabled
panel_149 = Panel(expression_76)  # disabled
panel_150 = Panel(expression_77)  # disabled
addition_6 = Addition(A=panel_148, B=panel_149)  # disabled
expression_78 = Expression(O=addition_6, Expression="FORMAT(\"{0:R}\",O)")  # disabled
panel_151 = Panel(expression_78)  # disabled
division_11 = Division(A=panel_151, B=2)  # disabled
expression_79 = Expression(O=division_11, Expression="FORMAT(\"{0:R}\",O)")  # disabled
panel_152 = Panel(expression_79)  # disabled
scale_27 = Scale(Geometry=scale_26.Geometry, Center=Point(0, 0, 0), Factor=expr("1/X", panel_152))  # -> Geometry, Transform; disabled
scale_28 = Scale(Geometry=curve_82, Center=Point(0, 0, 0), Factor=expr("1/X", panel_152))  # -> Geometry, Transform; disabled
evaluate_length_24 = EvaluateLength(Curve=scale_28.Geometry, Length=1, Normalized=True)  # -> Point, Tangent, Parameter; disabled
deconstruct_12 = Deconstruct(Point=evaluate_length_24.Point)  # -> XComponent, YComponent, ZComponent; disabled
expression_80 = Expression(O=deconstruct_12.YComponent, Expression="FORMAT(\"{0:R}\",O)")  # disabled
expression_81 = Expression(O=deconstruct_12.XComponent, Expression="FORMAT(\"{0:R}\",O)")  # disabled
expression_82 = Expression(O=deconstruct_12.ZComponent, Expression="FORMAT(\"{0:R}\",O)")  # disabled
panel_153 = Panel(expression_80)  # disabled
panel_154 = Panel(expression_81)  # disabled
panel_155 = Panel(expression_82)  # disabled
division_12 = Division(A=panel_149, B=panel_148)  # disabled
expression_83 = Expression(O=division_12, Expression="FORMAT(\"{0:R}\",O)")  # disabled
panel_156 = Panel(expression_83)  # disabled
curve_83 = Curve(scale_28.Geometry)  # disabled
point_11 = Point(scale_27.Geometry)  # disabled

move_11 = Move(Geometry=curve_83, Motion=Vector(12.5, 0, 0))  # -> Geometry, Transform; disabled
mirror_11 = Mirror(Geometry=curve_83, Plane=PlaneYZ(0, 0, 0))  # -> Geometry, Transform; disabled
curve_84 = Curve(move_11.Geometry)  # disabled

vector_xyz_9 = VectorXYZ(XComponent=12.5, YComponent=1.5, ZComponent=0)  # -> Vector, Length; disabled
curve_85 = Curve(curve_83)  # disabled
end_points_16 = EndPoints(Curve=curve_85)  # -> Start, End; disabled
rectangle_2pt_16 = Rectangle2Pt(Plane=PlaneXY(0, 0, 0), PointA=end_points_16.Start, PointB=end_points_16.End, Radius=0)  # -> Rectangle, Length; disabled
deconstuct_rectangle_6 = DeconstuctRectangle(Rectangle=rectangle_2pt_16.Rectangle)  # -> BasePlane, XInterval, YInterval; disabled
deconstruct_domain_11 = DeconstructDomain(Domain=deconstuct_rectangle_6.YInterval)  # -> Start, End; disabled
deconstruct_domain_12 = DeconstructDomain(Domain=deconstuct_rectangle_6.XInterval)  # -> Start, End; disabled
scale_nu_6 = ScaleNU(
    Geometry=curve_83,
    Plane=PlaneXY(0, 0, 0),
    ScaleX=expr("1/X", deconstruct_domain_12.End),
    ScaleY=expr("1/X", deconstruct_domain_11.End),
    ScaleZ=1)  # -> Geometry, Transform; disabled
curve_86 = Curve(scale_nu_6.Geometry)  # disabled
move_12 = Move(Geometry=curve_86, Motion=vector_xyz_9.Vector)  # -> Geometry, Transform; disabled
curve_87 = Curve(move_12.Geometry)  # disabled

digit_scroller_103 = DigitScroller(Scroller_Digits=12, Scroller_Prefix=" ", Scroller_Radix=2, Scroller_Value=0)  # disabled
stream_filter_16 = StreamFilter(Gate=number_slider_22, Stream0=curve_83, Stream1=curve_86)  # disabled
curve_88 = Curve(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)  # disabled
curve_89 = Curve(stream_filter_16)  # disabled
scale_29 = Scale(Geometry=curve_89, Center=Point(0, 0, 0), Factor=expr("2^X", number))  # -> Geometry, Transform; disabled
curve_90 = Curve(scale_29.Geometry)  # disabled
curve_91 = Curve(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)  # disabled

digit_scroller_104 = DigitScroller(Scroller_Digits=12, Scroller_Prefix=" ", Scroller_Radix=1, Scroller_Value=0.0054935044)
panel_160 = Panel("""128    0.00549350440
256    0.001373312102167""")
panel_161 = Panel("0.001373312102167*4")

radians_7 = Radians(Degrees=digit_scroller_104)  # disabled

expression_84 = Expression(O=radians_7, Expression="FORMAT(\"{0:0.00000000000000000000}\",O)")  # disabled
panel_162 = Panel(expression_84)  # disabled

series_8 = Series(Start=0, Step=panel_162, Count=number_12)  # disabled
expression_85 = Expression(O=series_8, Expression="FORMAT(\"{0:R}\",O)")  # disabled
panel_163 = Panel(expression_85)  # disabled
bounds_6 = Bounds(Numbers=series_8)  # disabled

curve_graph_mapper_6 = CurveGraphMapper(Curves=curve_38, Rectangle=rectangle_2pt_2.Rectangle, Values=series_8, Flip=False, Snap=True, TextSize=0.015625)  # -> Mapped, GraphCurves, GraphPoints, ValueLines, ValuePoints, MappedLines, MappedPoints, Boundary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; disabled
graphmapper_6 = GraphMapper(Curve=curve_38, Boundary=rectangle_2pt_2.Rectangle, Numbers=series_8, Input=bounds_6, Output=bounds_6, bobo=False)  # disabled
stream_filter_17 = StreamFilter(Gate=number_slider_23, Stream0=curve_graph_mapper_6.Mapped, Stream1=graphmapper_6)  # disabled

turtle_7 = DotNETVBScriptLEGACY(Forward=duplicate_data_2, Left=stream_filter_17)  # -> Output, Points; inputs Forward: list, Left: list; disabled; same code as turtle

expression_86 = Expression(O=turtle_7.Points, Expression="FORMAT(\"{0:R}\",O)")  # disabled
panel_164 = Panel(expression_86)  # disabled

point_12 = Point(turtle_7.Points)  # disabled
scale_30 = Scale(Geometry=point_12, Center=Point(0, 0, 0), Factor=expr("2^X", digit_scroller_50))  # -> Geometry, Transform; disabled

interpolate_t_7 = InterpolateT(Vertices=scale_30.Geometry, TangentStart=Vector(0.0625, 0, 0), TangentEnd=Vector(0, 0, 0), KnotStyle=2)  # -> Curve, Length, Domain; disabled
evaluate_length_25 = EvaluateLength(Curve=interpolate_t_7.Curve, Length=1, Normalized=True)  # -> Point, Tangent, Parameter; disabled
line_sdl_11 = LineSDL(Start=evaluate_length_25.Point, Direction=evaluate_length_25.Tangent, Length=1)  # disabled
mirror_12 = Mirror(Geometry=interpolate_t_7.Curve, Plane=line_sdl_11)  # -> Geometry, Transform; disabled
join_curves_13 = JoinCurves(Curves=[interpolate_t_7.Curve, mirror_12.Geometry], Preserve=False)  # disabled
evaluate_length_26 = EvaluateLength(Curve=join_curves_13, Length=1, Normalized=True)  # -> Point, Tangent, Parameter; disabled
rotate_7 = Rotate(Geometry=join_curves_13, Angle=3.141592654, Plane=evaluate_length_26.Point)  # -> Geometry, Transform; disabled
join_curves_14 = JoinCurves(Curves=[join_curves_13, rotate_7.Geometry], Preserve=False)  # disabled
curve_92 = Curve(join_curves_14)  # disabled

evaluate_length_27 = EvaluateLength(Curve=join_curves_14, Length=1, Normalized=True)  # -> Point, Tangent, Parameter; disabled
deconstruct_13 = Deconstruct(Point=evaluate_length_27.Point)  # -> XComponent, YComponent, ZComponent; disabled
expression_87 = Expression(O=deconstruct_13.YComponent, Expression="FORMAT(\"{0:R}\",O)")  # disabled
expression_88 = Expression(O=deconstruct_13.XComponent, Expression="FORMAT(\"{0:R}\",O)")  # disabled
expression_89 = Expression(O=deconstruct_13.ZComponent, Expression="FORMAT(\"{0:R}\",O)")  # disabled
panel_165 = Panel(expression_87)  # disabled
panel_166 = Panel(expression_88)  # disabled
panel_167 = Panel(expression_89)  # disabled
addition_7 = Addition(A=panel_165, B=panel_166)  # disabled
expression_90 = Expression(O=addition_7, Expression="FORMAT(\"{0:R}\",O)")  # disabled
panel_168 = Panel(expression_90)  # disabled
division_13 = Division(A=panel_168, B=2)  # disabled
expression_91 = Expression(O=division_13, Expression="FORMAT(\"{0:R}\",O)")  # disabled
panel_169 = Panel(expression_91)  # disabled
scale_31 = Scale(Geometry=scale_30.Geometry, Center=Point(0, 0, 0), Factor=expr("1/X", panel_169))  # -> Geometry, Transform; disabled
scale_32 = Scale(Geometry=curve_92, Center=Point(0, 0, 0), Factor=expr("1/X", panel_169))  # -> Geometry, Transform; disabled
evaluate_length_28 = EvaluateLength(Curve=scale_32.Geometry, Length=1, Normalized=True)  # -> Point, Tangent, Parameter; disabled
deconstruct_14 = Deconstruct(Point=evaluate_length_28.Point)  # -> XComponent, YComponent, ZComponent; disabled
expression_92 = Expression(O=deconstruct_14.YComponent, Expression="FORMAT(\"{0:R}\",O)")  # disabled
expression_93 = Expression(O=deconstruct_14.XComponent, Expression="FORMAT(\"{0:R}\",O)")  # disabled
expression_94 = Expression(O=deconstruct_14.ZComponent, Expression="FORMAT(\"{0:R}\",O)")  # disabled
panel_170 = Panel(expression_92)  # disabled
panel_171 = Panel(expression_93)  # disabled
panel_172 = Panel(expression_94)  # disabled
division_14 = Division(A=panel_166, B=panel_165)  # disabled
expression_95 = Expression(O=division_14, Expression="FORMAT(\"{0:R}\",O)")  # disabled
panel_173 = Panel(expression_95)  # disabled
curve_93 = Curve(scale_32.Geometry)  # disabled
point_13 = Point(scale_31.Geometry)  # disabled

move_13 = Move(Geometry=curve_93, Motion=vector_xyz.Vector)  # -> Geometry, Transform; disabled
mirror_13 = Mirror(Geometry=curve_93, Plane=PlaneYZ(0, 0, 0))  # -> Geometry, Transform; disabled
curve_94 = Curve(move_13.Geometry)  # disabled

radians_8 = Radians(Degrees=digit_scroller_104)

expression_96 = Expression(O=radians_8, Expression="FORMAT(\"{0:0.00000000000000000000}\",O)")
panel_175 = Panel(expression_96)

series_9 = Series(Start=0, Step=panel_175, Count=number_18)
expression_97 = Expression(O=series_9, Expression="FORMAT(\"{0:R}\",O)")
panel_176 = Panel(expression_97)
bounds_7 = Bounds(Numbers=series_9)

curve_graph_mapper_7 = CurveGraphMapper(Curves=curve_49, Rectangle=rectangle_2pt_5.Rectangle, Values=series_9, Flip=False, Snap=True, TextSize=0.015625)  # -> Mapped, GraphCurves, GraphPoints, ValueLines, ValuePoints, MappedLines, MappedPoints, Boundary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; disabled
graphmapper_7 = GraphMapper(Curve=curve_49, Boundary=rectangle_2pt_5.Rectangle, Numbers=series_9, Input=bounds_7, Output=bounds_7, bobo=False)
stream_filter_18 = StreamFilter(Gate=number_slider_23, Stream0=curve_graph_mapper_7.Mapped, Stream1=graphmapper_7)

turtle_8 = DotNETVBScriptLEGACY(Forward=duplicate_data_4, Left=stream_filter_18)  # -> Output, Points; inputs Forward: list, Left: list; same code as turtle

expression_98 = Expression(O=turtle_8.Points, Expression="FORMAT(\"{0:R}\",O)")
panel_177 = Panel(expression_98)

point_14 = Point(turtle_8.Points)
scale_33 = Scale(Geometry=point_14, Center=Point(0, 0, 0), Factor=expr("2^X", digit_scroller_64))  # -> Geometry, Transform

interpolate_t_8 = InterpolateT(Vertices=scale_33.Geometry, TangentStart=Vector(0.0625, 0, 0), TangentEnd=Vector(0, 0, 0), KnotStyle=2)  # -> Curve, Length, Domain
evaluate_length_29 = EvaluateLength(Curve=interpolate_t_8.Curve, Length=1, Normalized=True)  # -> Point, Tangent, Parameter
line_sdl_12 = LineSDL(Start=evaluate_length_29.Point, Direction=evaluate_length_29.Tangent, Length=1)
mirror_14 = Mirror(Geometry=interpolate_t_8.Curve, Plane=line_sdl_12)  # -> Geometry, Transform
join_curves_15 = JoinCurves(Curves=[interpolate_t_8.Curve, mirror_14.Geometry], Preserve=False)
evaluate_length_30 = EvaluateLength(Curve=join_curves_15, Length=1, Normalized=True)  # -> Point, Tangent, Parameter
rotate_8 = Rotate(Geometry=join_curves_15, Angle=3.141592654, Plane=evaluate_length_30.Point)  # -> Geometry, Transform
join_curves_16 = JoinCurves(Curves=[join_curves_15, rotate_8.Geometry], Preserve=False)
curve_95 = Curve(join_curves_16)

evaluate_length_31 = EvaluateLength(Curve=join_curves_16, Length=1, Normalized=True)  # -> Point, Tangent, Parameter
deconstruct_15 = Deconstruct(Point=evaluate_length_31.Point)  # -> XComponent, YComponent, ZComponent
expression_99 = Expression(O=deconstruct_15.YComponent, Expression="FORMAT(\"{0:R}\",O)")
expression_100 = Expression(O=deconstruct_15.XComponent, Expression="FORMAT(\"{0:R}\",O)")
expression_101 = Expression(O=deconstruct_15.ZComponent, Expression="FORMAT(\"{0:R}\",O)")
panel_178 = Panel(expression_99)
panel_179 = Panel(expression_100)
panel_180 = Panel(expression_101)
addition_8 = Addition(A=panel_178, B=panel_179)
expression_102 = Expression(O=addition_8, Expression="FORMAT(\"{0:R}\",O)")
panel_181 = Panel(expression_102)
division_15 = Division(A=panel_181, B=2)
expression_103 = Expression(O=division_15, Expression="FORMAT(\"{0:R}\",O)")
panel_182 = Panel(expression_103)
scale_34 = Scale(Geometry=scale_33.Geometry, Center=Point(0, 0, 0), Factor=expr("1/X", panel_182))  # -> Geometry, Transform
scale_35 = Scale(Geometry=curve_95, Center=Point(0, 0, 0), Factor=expr("1/X", panel_182))  # -> Geometry, Transform
evaluate_length_32 = EvaluateLength(Curve=scale_35.Geometry, Length=1, Normalized=True)  # -> Point, Tangent, Parameter
deconstruct_16 = Deconstruct(Point=evaluate_length_32.Point)  # -> XComponent, YComponent, ZComponent
expression_104 = Expression(O=deconstruct_16.YComponent, Expression="FORMAT(\"{0:R}\",O)")
expression_105 = Expression(O=deconstruct_16.XComponent, Expression="FORMAT(\"{0:R}\",O)")
expression_106 = Expression(O=deconstruct_16.ZComponent, Expression="FORMAT(\"{0:R}\",O)")
panel_183 = Panel(expression_104)
panel_184 = Panel(expression_105)
panel_185 = Panel(expression_106)
division_16 = Division(A=panel_179, B=panel_178)
expression_107 = Expression(O=division_16, Expression="FORMAT(\"{0:R}\",O)")
panel_186 = Panel(expression_107)
curve_96 = Curve(scale_35.Geometry)
point_15 = Point(scale_34.Geometry)

curve_97 = Curve(curve_96)

move_14 = Move(Geometry=curve_96, Motion=vector_xyz_2.Vector)  # -> Geometry, Transform
mirror_15 = Mirror(Geometry=curve_96, Plane=PlaneYZ(0, 0, 0))  # -> Geometry, Transform
curve_98 = Curve(move_14.Geometry)

radians_9 = Radians(Degrees=digit_scroller_104)  # disabled

expression_108 = Expression(O=radians_9, Expression="FORMAT(\"{0:0.00000000000000000000}\",O)")  # disabled
panel_189 = Panel(expression_108)  # disabled

series_10 = Series(Start=0, Step=panel_189, Count=number_21)  # disabled
expression_109 = Expression(O=series_10, Expression="FORMAT(\"{0:R}\",O)")  # disabled
panel_190 = Panel(expression_109)  # disabled
bounds_8 = Bounds(Numbers=series_10)  # disabled

curve_graph_mapper_8 = CurveGraphMapper(Curves=curve_59, Rectangle=rectangle_2pt_8.Rectangle, Values=series_10, Flip=False, Snap=True, TextSize=0.015625)  # -> Mapped, GraphCurves, GraphPoints, ValueLines, ValuePoints, MappedLines, MappedPoints, Boundary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; disabled
graphmapper_8 = GraphMapper(Curve=curve_59, Boundary=rectangle_2pt_8.Rectangle, Numbers=series_10, Input=bounds_8, Output=bounds_8, bobo=True)  # disabled
stream_filter_19 = StreamFilter(Gate=number_slider_23, Stream0=curve_graph_mapper_8.Mapped, Stream1=graphmapper_8)  # disabled

turtle_9 = DotNETVBScriptLEGACY(Forward=duplicate_data_6, Left=stream_filter_19)  # -> Output, Points; inputs Forward: list, Left: list; disabled; same code as turtle

expression_110 = Expression(O=turtle_9.Points, Expression="FORMAT(\"{0:R}\",O)")  # disabled
panel_191 = Panel(expression_110)  # disabled

point_16 = Point(turtle_9.Points)  # disabled
scale_36 = Scale(Geometry=point_16, Center=Point(0, 0, 0), Factor=expr("2^X", digit_scroller_71))  # -> Geometry, Transform; disabled

interpolate_t_9 = InterpolateT(Vertices=scale_36.Geometry, TangentStart=Vector(0.0625, 0, 0), TangentEnd=Vector(0, 0, 0), KnotStyle=2)  # -> Curve, Length, Domain; disabled
evaluate_length_33 = EvaluateLength(Curve=interpolate_t_9.Curve, Length=1, Normalized=True)  # -> Point, Tangent, Parameter; disabled
line_sdl_13 = LineSDL(Start=evaluate_length_33.Point, Direction=evaluate_length_33.Tangent, Length=1)  # disabled
mirror_16 = Mirror(Geometry=interpolate_t_9.Curve, Plane=line_sdl_13)  # -> Geometry, Transform; disabled
join_curves_17 = JoinCurves(Curves=[interpolate_t_9.Curve, mirror_16.Geometry], Preserve=False)  # disabled
evaluate_length_34 = EvaluateLength(Curve=join_curves_17, Length=1, Normalized=True)  # -> Point, Tangent, Parameter; disabled
rotate_9 = Rotate(Geometry=join_curves_17, Angle=3.141592654, Plane=evaluate_length_34.Point)  # -> Geometry, Transform; disabled
join_curves_18 = JoinCurves(Curves=[join_curves_17, rotate_9.Geometry], Preserve=False)  # disabled
curve_99 = Curve(join_curves_18)  # disabled

evaluate_length_35 = EvaluateLength(Curve=join_curves_18, Length=1, Normalized=True)  # -> Point, Tangent, Parameter; disabled
deconstruct_17 = Deconstruct(Point=evaluate_length_35.Point)  # -> XComponent, YComponent, ZComponent; disabled
expression_111 = Expression(O=deconstruct_17.YComponent, Expression="FORMAT(\"{0:R}\",O)")  # disabled
expression_112 = Expression(O=deconstruct_17.XComponent, Expression="FORMAT(\"{0:R}\",O)")  # disabled
expression_113 = Expression(O=deconstruct_17.ZComponent, Expression="FORMAT(\"{0:R}\",O)")  # disabled
panel_192 = Panel(expression_111)  # disabled
panel_193 = Panel(expression_112)  # disabled
panel_194 = Panel(expression_113)  # disabled
addition_9 = Addition(A=panel_192, B=panel_193)  # disabled
expression_114 = Expression(O=addition_9, Expression="FORMAT(\"{0:R}\",O)")  # disabled
panel_195 = Panel(expression_114)  # disabled
division_17 = Division(A=panel_195, B=2)  # disabled
expression_115 = Expression(O=division_17, Expression="FORMAT(\"{0:R}\",O)")  # disabled
panel_196 = Panel(expression_115)  # disabled
scale_37 = Scale(Geometry=scale_36.Geometry, Center=Point(0, 0, 0), Factor=expr("1/X", panel_196))  # -> Geometry, Transform; disabled
scale_38 = Scale(Geometry=curve_99, Center=Point(0, 0, 0), Factor=expr("1/X", panel_196))  # -> Geometry, Transform; disabled
evaluate_length_36 = EvaluateLength(Curve=scale_38.Geometry, Length=1, Normalized=True)  # -> Point, Tangent, Parameter; disabled
deconstruct_18 = Deconstruct(Point=evaluate_length_36.Point)  # -> XComponent, YComponent, ZComponent; disabled
expression_116 = Expression(O=deconstruct_18.YComponent, Expression="FORMAT(\"{0:R}\",O)")  # disabled
expression_117 = Expression(O=deconstruct_18.XComponent, Expression="FORMAT(\"{0:R}\",O)")  # disabled
expression_118 = Expression(O=deconstruct_18.ZComponent, Expression="FORMAT(\"{0:R}\",O)")  # disabled
panel_197 = Panel(expression_116)  # disabled
panel_198 = Panel(expression_117)  # disabled
panel_199 = Panel(expression_118)  # disabled
division_18 = Division(A=panel_193, B=panel_192)  # disabled
expression_119 = Expression(O=division_18, Expression="FORMAT(\"{0:R}\",O)")  # disabled
panel_200 = Panel(expression_119)  # disabled
curve_100 = Curve(scale_38.Geometry)  # disabled
point_17 = Point(scale_37.Geometry)  # disabled

move_15 = Move(Geometry=curve_100, Motion=vector_xyz_3.Vector)  # -> Geometry, Transform; disabled
mirror_17 = Mirror(Geometry=curve_100, Plane=PlaneYZ(0, 0, 0))  # -> Geometry, Transform; disabled
curve_101 = Curve(move_15.Geometry)  # disabled

radians_10 = Radians(Degrees=digit_scroller_104)  # disabled

expression_120 = Expression(O=radians_10, Expression="FORMAT(\"{0:0.00000000000000000000}\",O)")  # disabled
panel_202 = Panel(expression_120)  # disabled

series_11 = Series(Start=0, Step=panel_202, Count=number_28)  # disabled
expression_121 = Expression(O=series_11, Expression="FORMAT(\"{0:R}\",O)")  # disabled
panel_203 = Panel(expression_121)  # disabled
bounds_9 = Bounds(Numbers=series_11)  # disabled

curve_graph_mapper_9 = CurveGraphMapper(Curves=curve_69, Rectangle=rectangle_2pt_11.Rectangle, Values=series_11, Flip=False, Snap=True, TextSize=0.015625)  # -> Mapped, GraphCurves, GraphPoints, ValueLines, ValuePoints, MappedLines, MappedPoints, Boundary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; disabled
graphmapper_9 = GraphMapper(Curve=curve_69, Boundary=rectangle_2pt_11.Rectangle, Numbers=series_11, Input=bounds_9, Output=bounds_9, bobo=True)  # disabled
stream_filter_20 = StreamFilter(Gate=number_slider_23, Stream0=curve_graph_mapper_9.Mapped, Stream1=graphmapper_9)  # disabled

turtle_10 = DotNETVBScriptLEGACY(Forward=duplicate_data_8, Left=stream_filter_20)  # -> Output, Points; inputs Forward: list, Left: list; disabled; same code as turtle

expression_122 = Expression(O=turtle_10.Points, Expression="FORMAT(\"{0:R}\",O)")  # disabled
panel_204 = Panel(expression_122)  # disabled

point_18 = Point(turtle_10.Points)  # disabled
scale_39 = Scale(Geometry=point_18, Center=Point(0, 0, 0), Factor=expr("2^X", digit_scroller_88))  # -> Geometry, Transform; disabled

interpolate_t_10 = InterpolateT(Vertices=scale_39.Geometry, TangentStart=Vector(0.0625, 0, 0), TangentEnd=Vector(0, 0, 0), KnotStyle=2)  # -> Curve, Length, Domain; disabled
evaluate_length_37 = EvaluateLength(Curve=interpolate_t_10.Curve, Length=1, Normalized=True)  # -> Point, Tangent, Parameter; disabled
line_sdl_14 = LineSDL(Start=evaluate_length_37.Point, Direction=evaluate_length_37.Tangent, Length=1)  # disabled
mirror_18 = Mirror(Geometry=interpolate_t_10.Curve, Plane=line_sdl_14)  # -> Geometry, Transform; disabled
join_curves_19 = JoinCurves(Curves=[interpolate_t_10.Curve, mirror_18.Geometry], Preserve=False)  # disabled
evaluate_length_38 = EvaluateLength(Curve=join_curves_19, Length=1, Normalized=True)  # -> Point, Tangent, Parameter; disabled
rotate_10 = Rotate(Geometry=join_curves_19, Angle=3.141592654, Plane=evaluate_length_38.Point)  # -> Geometry, Transform; disabled
join_curves_20 = JoinCurves(Curves=[join_curves_19, rotate_10.Geometry], Preserve=False)  # disabled
curve_102 = Curve(join_curves_20)  # disabled

evaluate_length_39 = EvaluateLength(Curve=join_curves_20, Length=1, Normalized=True)  # -> Point, Tangent, Parameter; disabled
deconstruct_19 = Deconstruct(Point=evaluate_length_39.Point)  # -> XComponent, YComponent, ZComponent; disabled
expression_123 = Expression(O=deconstruct_19.YComponent, Expression="FORMAT(\"{0:R}\",O)")  # disabled
expression_124 = Expression(O=deconstruct_19.XComponent, Expression="FORMAT(\"{0:R}\",O)")  # disabled
expression_125 = Expression(O=deconstruct_19.ZComponent, Expression="FORMAT(\"{0:R}\",O)")  # disabled
panel_205 = Panel(expression_123)  # disabled
panel_206 = Panel(expression_124)  # disabled
panel_207 = Panel(expression_125)  # disabled
addition_10 = Addition(A=panel_205, B=panel_206)  # disabled
expression_126 = Expression(O=addition_10, Expression="FORMAT(\"{0:R}\",O)")  # disabled
panel_208 = Panel(expression_126)  # disabled
division_19 = Division(A=panel_208, B=2)  # disabled
expression_127 = Expression(O=division_19, Expression="FORMAT(\"{0:R}\",O)")  # disabled
panel_209 = Panel(expression_127)  # disabled
scale_40 = Scale(Geometry=scale_39.Geometry, Center=Point(0, 0, 0), Factor=expr("1/X", panel_209))  # -> Geometry, Transform; disabled
scale_41 = Scale(Geometry=curve_102, Center=Point(0, 0, 0), Factor=expr("1/X", panel_209))  # -> Geometry, Transform; disabled
evaluate_length_40 = EvaluateLength(Curve=scale_41.Geometry, Length=1, Normalized=True)  # -> Point, Tangent, Parameter; disabled
deconstruct_20 = Deconstruct(Point=evaluate_length_40.Point)  # -> XComponent, YComponent, ZComponent; disabled
expression_128 = Expression(O=deconstruct_20.YComponent, Expression="FORMAT(\"{0:R}\",O)")  # disabled
expression_129 = Expression(O=deconstruct_20.XComponent, Expression="FORMAT(\"{0:R}\",O)")  # disabled
expression_130 = Expression(O=deconstruct_20.ZComponent, Expression="FORMAT(\"{0:R}\",O)")  # disabled
panel_210 = Panel(expression_128)  # disabled
panel_211 = Panel(expression_129)  # disabled
panel_212 = Panel(expression_130)  # disabled
division_20 = Division(A=panel_206, B=panel_205)  # disabled
expression_131 = Expression(O=division_20, Expression="FORMAT(\"{0:R}\",O)")  # disabled
panel_213 = Panel(expression_131)  # disabled
curve_103 = Curve(scale_41.Geometry)  # disabled
point_19 = Point(scale_40.Geometry)  # disabled

move_16 = Move(Geometry=curve_103, Motion=vector_xyz_5.Vector)  # -> Geometry, Transform; disabled
mirror_19 = Mirror(Geometry=curve_103, Plane=PlaneYZ(0, 0, 0))  # -> Geometry, Transform; disabled
curve_104 = Curve(move_16.Geometry)  # disabled

radians_11 = Radians(Degrees=digit_scroller_104)  # disabled

expression_132 = Expression(O=radians_11, Expression="FORMAT(\"{0:0.00000000000000000000}\",O)")  # disabled
panel_215 = Panel(expression_132)  # disabled

series_12 = Series(Start=0, Step=panel_215, Count=number_33)  # disabled
expression_133 = Expression(O=series_12, Expression="FORMAT(\"{0:R}\",O)")  # disabled
panel_216 = Panel(expression_133)  # disabled
bounds_10 = Bounds(Numbers=series_12)  # disabled

curve_graph_mapper_10 = CurveGraphMapper(Curves=curve_79, Rectangle=rectangle_2pt_14.Rectangle, Values=series_12, Flip=False, Snap=True, TextSize=0.015625)  # -> Mapped, GraphCurves, GraphPoints, ValueLines, ValuePoints, MappedLines, MappedPoints, Boundary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; disabled
graphmapper_10 = GraphMapper(Curve=curve_79, Boundary=rectangle_2pt_14.Rectangle, Numbers=series_12, Input=bounds_10, Output=bounds_10, bobo=True)  # disabled
stream_filter_21 = StreamFilter(Gate=number_slider_23, Stream0=curve_graph_mapper_10.Mapped, Stream1=graphmapper_10)  # disabled

turtle_11 = DotNETVBScriptLEGACY(Forward=duplicate_data_10, Left=stream_filter_21)  # -> Output, Points; inputs Forward: list, Left: list; disabled; same code as turtle

expression_134 = Expression(O=turtle_11.Points, Expression="FORMAT(\"{0:R}\",O)")  # disabled
panel_217 = Panel(expression_134)  # disabled

point_20 = Point(turtle_11.Points)  # disabled
scale_42 = Scale(Geometry=point_20, Center=Point(0, 0, 0), Factor=expr("2^X", digit_scroller_95))  # -> Geometry, Transform; disabled

interpolate_t_11 = InterpolateT(Vertices=scale_42.Geometry, TangentStart=Vector(0.0625, 0, 0), TangentEnd=Vector(0, 0, 0), KnotStyle=2)  # -> Curve, Length, Domain; disabled
evaluate_length_41 = EvaluateLength(Curve=interpolate_t_11.Curve, Length=1, Normalized=True)  # -> Point, Tangent, Parameter; disabled
line_sdl_15 = LineSDL(Start=evaluate_length_41.Point, Direction=evaluate_length_41.Tangent, Length=1)  # disabled
mirror_20 = Mirror(Geometry=interpolate_t_11.Curve, Plane=line_sdl_15)  # -> Geometry, Transform; disabled
join_curves_21 = JoinCurves(Curves=[interpolate_t_11.Curve, mirror_20.Geometry], Preserve=False)  # disabled
evaluate_length_42 = EvaluateLength(Curve=join_curves_21, Length=1, Normalized=True)  # -> Point, Tangent, Parameter; disabled
rotate_11 = Rotate(Geometry=join_curves_21, Angle=3.141592654, Plane=evaluate_length_42.Point)  # -> Geometry, Transform; disabled
join_curves_22 = JoinCurves(Curves=[join_curves_21, rotate_11.Geometry], Preserve=False)  # disabled
curve_105 = Curve(join_curves_22)  # disabled

evaluate_length_43 = EvaluateLength(Curve=join_curves_22, Length=1, Normalized=True)  # -> Point, Tangent, Parameter; disabled
deconstruct_21 = Deconstruct(Point=evaluate_length_43.Point)  # -> XComponent, YComponent, ZComponent; disabled
expression_135 = Expression(O=deconstruct_21.YComponent, Expression="FORMAT(\"{0:R}\",O)")  # disabled
expression_136 = Expression(O=deconstruct_21.XComponent, Expression="FORMAT(\"{0:R}\",O)")  # disabled
expression_137 = Expression(O=deconstruct_21.ZComponent, Expression="FORMAT(\"{0:R}\",O)")  # disabled
panel_218 = Panel(expression_135)  # disabled
panel_219 = Panel(expression_136)  # disabled
panel_220 = Panel(expression_137)  # disabled
addition_11 = Addition(A=panel_218, B=panel_219)  # disabled
expression_138 = Expression(O=addition_11, Expression="FORMAT(\"{0:R}\",O)")  # disabled
panel_221 = Panel(expression_138)  # disabled
division_21 = Division(A=panel_221, B=2)  # disabled
expression_139 = Expression(O=division_21, Expression="FORMAT(\"{0:R}\",O)")  # disabled
panel_222 = Panel(expression_139)  # disabled
scale_43 = Scale(Geometry=scale_42.Geometry, Center=Point(0, 0, 0), Factor=expr("1/X", panel_222))  # -> Geometry, Transform; disabled
scale_44 = Scale(Geometry=curve_105, Center=Point(0, 0, 0), Factor=expr("1/X", panel_222))  # -> Geometry, Transform; disabled
evaluate_length_44 = EvaluateLength(Curve=scale_44.Geometry, Length=1, Normalized=True)  # -> Point, Tangent, Parameter; disabled
deconstruct_22 = Deconstruct(Point=evaluate_length_44.Point)  # -> XComponent, YComponent, ZComponent; disabled
expression_140 = Expression(O=deconstruct_22.YComponent, Expression="FORMAT(\"{0:R}\",O)")  # disabled
expression_141 = Expression(O=deconstruct_22.XComponent, Expression="FORMAT(\"{0:R}\",O)")  # disabled
expression_142 = Expression(O=deconstruct_22.ZComponent, Expression="FORMAT(\"{0:R}\",O)")  # disabled
panel_223 = Panel(expression_140)  # disabled
panel_224 = Panel(expression_141)  # disabled
panel_225 = Panel(expression_142)  # disabled
division_22 = Division(A=panel_219, B=panel_218)  # disabled
expression_143 = Expression(O=division_22, Expression="FORMAT(\"{0:R}\",O)")  # disabled
panel_226 = Panel(expression_143)  # disabled
curve_106 = Curve(scale_44.Geometry)  # disabled
point_21 = Point(scale_43.Geometry)  # disabled

curve_107 = Curve(curve_106)  # disabled

curve_108 = Curve(curve_107)  # disabled
curve_domain = CurveDomain(Curve=curve_108)  # -> Curve, Domain; disabled
deconstruct_domain_13 = DeconstructDomain(Domain=curve_domain.Domain)  # -> Start, End; disabled
construct_domain = ConstructDomain(DomainStart=expr("X/2", deconstruct_domain_13.End), DomainEnd=deconstruct_domain_13.End)  # disabled
sub_curve = SubCurve(BaseCurve=curve_domain.Curve, Domain=construct_domain)  # disabled
move_17 = Move(Geometry=sub_curve, Motion=Vector(-0.5, -0.5, 0))  # -> Geometry, Transform; disabled
scale_45 = Scale(Geometry=move_17.Geometry, Center=Point(0, 0, 0), Factor=2)  # -> Geometry, Transform; disabled
curve_109 = Curve(scale_45.Geometry)  # disabled

curve_110 = Curve(curve_109)  # disabled
scale_46 = Scale(Geometry=curve_110, Center=Point(0, 0, 0), Factor=expr("2^X", number_2))  # -> Geometry, Transform; disabled
curve_curve = CurveCurve(CurveA=scale_46.Geometry, CurveB=scale_20.Geometry)  # -> flatten(Points), ParamsA, ParamsB; disabled
scale_47 = Scale(Geometry=curve_curve.Points, Center=Point(0, 0, 0), Factor=expr("1/2^X", number_2))  # -> Geometry, Transform; disabled
deconstruct_23 = Deconstruct(Point=scale_47.Geometry)  # -> expr("ABS(X)", graft(XComponent)), expr("ABS(X)", graft(YComponent)), expr("ABS(X)", graft(ZComponent)); disabled
construct_point_3 = ConstructPoint(XCoordinate=deconstruct_23.XComponent, YCoordinate=deconstruct_23.YComponent, ZCoordinate=deconstruct_23.ZComponent)  # disabled
list_length = ListLength(List=scale_47.Geometry)  # disabled
panel_228 = Panel(list_length)  # disabled
construct_domain_2 = ConstructDomain(DomainStart=0, DomainEnd=expr("X-2", panel_228))  # disabled
range = Range(Domain=construct_domain_2, Steps=expr("X-2", panel_228))  # disabled
list_item = ListItem(List=flatten(construct_point_3), Index=range, Wrap=False)  # -> flatten(Item); disabled
rotate_12 = Rotate(Geometry=list_item, Angle=3.141592654, Plane=construct_point_2)  # -> reverse(flatten(Geometry)), Transform; disabled
merge = Merge(Data1=list_item, Data2=construct_point_2, Data3=rotate_12.Geometry)  # disabled
deconstruct_24 = Deconstruct(Point=merge)  # -> graft(XComponent), graft(YComponent), ZComponent; disabled
expression_144 = Expression(O=deconstruct_24.XComponent, Expression="FORMAT(\"{0:0.0000000000}\",O)")  # disabled
expression_145 = Expression(O=deconstruct_24.XComponent, Expression="FORMAT(\"{0:R}\",O)")  # disabled
data = Data(expression_144)  # disabled
panel_229 = Panel(data)  # disabled
expression_146 = Expression(O=deconstruct_24.YComponent, Expression="FORMAT(\"{0:0.00000000000000}\",O)")  # disabled
expression_147 = Expression(O=deconstruct_24.YComponent, Expression="FORMAT(\"{0:R}\",O)")  # disabled
data_2 = Data(expression_147)  # disabled
panel_230 = Panel(data_2)  # disabled
txtwriter = VBScript(filePath=file_path_2, data=flatten(panel_230), activate=button_2)  # -> out, A; inputs data: list; disabled
# ---------- txtwriter: VB ----------
    If activate Then

      Dim i As Integer
      Dim aryText(4) As String

      aryText(0) = "Mary WriteLine"
      aryText(1) = "Had"
      aryText(2) = "Another"
      aryText(3) = "Little"
      aryText(4) = "One"

      ' the data is appended to the file. If file doesnt exist, a new file is created
      Dim objWriter As New System.IO.StreamWriter(filePath, append)

      For i = 0 To data.Count - 1
        objWriter.WriteLine(data(i))
      Next

      objWriter.Close()

    End If

    If clearFile Then
      Dim objWriter As New System.IO.StreamWriter(filePath, False)
      objWriter.Close()
    End If
# ---------- end txtwriter ----------

curve_111 = Curve(curve_109)  # disabled
divide_curve_3 = DivideCurve(Curve=curve_111, Count=number_31, Kinks=False)  # -> Points, Tangents, Parameters; disabled
deconstruct_25 = Deconstruct(Point=divide_curve_3.Points)  # -> graft(XComponent), graft(YComponent), ZComponent; disabled
expression_148 = Expression(Y=deconstruct_25.YComponent, Expression="FORMAT(\"{0:R}\",ROUND(Y, 15))")  # -> simplify(Result); disabled
expression_149 = Expression(X=deconstruct_25.XComponent, Expression="FORMAT(\"{0:R}\",ROUND(X, 15))")  # -> simplify(Result); disabled
expression_150 = Expression(X=deconstruct_25.XComponent, Expression="FORMAT(\"{0:R}\",X)")  # -> simplify(Result); disabled
panel_231 = Panel(expression_150)  # disabled
expression_151 = Expression(Y=deconstruct_25.YComponent, Expression="FORMAT(\"{0:R}\",Y)")  # -> simplify(Result); disabled
list_length_2 = ListLength(List=divide_curve_3.Points)  # disabled
duplicate_data_12 = DuplicateData(Data=",", Number=list_length_2, Order=True)  # -> simplify(graft(Data)); disabled
panel_232 = Panel(duplicate_data_12)  # disabled
panel_233 = Panel(expression_151)  # disabled
concatenate = Concatenate(FragmentA=panel_231, FragmentB=panel_232, FragmentA_2=panel_233)  # -> flatten(Result); disabled
panel_234 = Panel(concatenate)  # disabled
txtwriter_2 = VBScript(filePath=file_path_3, data=flatten(panel_234), activate=button_3)  # -> out, A; inputs data: list; disabled; same code as txtwriter

move_18 = Move(Geometry=curve_106, Motion=vector_xyz_7.Vector)  # -> Geometry, Transform; disabled
mirror_21 = Mirror(Geometry=curve_106, Plane=PlaneYZ(0, 0, 0))  # -> Geometry, Transform; disabled
curve_112 = Curve(move_18.Geometry)  # disabled

curve_113 = Curve(curve_109)  # disabled
evaluate_length_45 = EvaluateLength(Curve=curve_113, Length=flatten(1), Normalized=True)  # -> Point, Tangent, Parameter; disabled
yz_plane = YZPlane(Origin=evaluate_length_45.Point)  # disabled
mirror_22 = Mirror(Geometry=curve_113, Plane=yz_plane)  # -> Geometry, Transform; disabled
join_curves_23 = JoinCurves(Curves=[curve_113, mirror_22.Geometry], Preserve=False)  # disabled
linear_array = LinearArray(Geometry=join_curves_23, Direction=Vector(2, 0, 0), Count=2)  # -> Geometry, Transform; disabled
join_curves_24 = JoinCurves(Curves=linear_array.Geometry, Preserve=False)  # disabled
flip_curve = FlipCurve(Curve=join_curves_24)  # -> Curve, Flag; disabled
stream_filter_22 = StreamFilter(Gate=number_slider_19, Stream0=join_curves_24, Stream1=flip_curve.Curve)  # disabled
curve_domain_2 = CurveDomain(Curve=stream_filter_22)  # -> Curve, Domain; disabled
deconstruct_domain_14 = DeconstructDomain(Domain=curve_domain_2.Domain)  # -> Start, End; disabled
construct_domain_3 = ConstructDomain(DomainStart=expr("X/8", deconstruct_domain_14.End), DomainEnd=expr("X*5/8", deconstruct_domain_14.End))  # disabled
sub_curve_2 = SubCurve(BaseCurve=curve_domain_2.Curve, Domain=construct_domain_3)  # disabled
move_19 = Move(Geometry=sub_curve_2, Motion=Vector(-0.5, -0.5, 0))  # -> Geometry, Transform; disabled
scale_48 = Scale(Geometry=move_19.Geometry, Center=Point(0, 0, 0), Factor=0.5)  # -> Geometry, Transform; disabled
divide_curve_4 = DivideCurve(Curve=scale_48.Geometry, Count=number_34, Kinks=False)  # -> Points, Tangents, Parameters; disabled
deconstruct_26 = Deconstruct(Point=divide_curve_4.Points)  # -> simplify(graft(XComponent)), simplify(graft(YComponent)), ZComponent; disabled
expression_152 = Expression(X=deconstruct_26.XComponent, Expression="FORMAT(\"{0:R}\",X)")  # disabled
panel_235 = Panel(expression_152)  # disabled
expression_153 = Expression(Y=deconstruct_26.YComponent, Expression="FORMAT(\"{0:R}\",Y)")  # disabled
list_length_3 = ListLength(List=divide_curve_4.Points)  # disabled
duplicate_data_13 = DuplicateData(Data=";", Number=list_length_3, Order=True)  # -> simplify(graft(Data)); disabled
panel_236 = Panel(duplicate_data_13)  # disabled
panel_237 = Panel(expression_153)  # disabled
concatenate_2 = Concatenate(FragmentA=panel_235, FragmentB=panel_236, FragmentA_2=panel_237)  # -> flatten(Result); disabled
panel_238 = Panel(concatenate_2)  # disabled
txtwriter_3 = VBScript(filePath=file_path_4, data=flatten(panel_238), activate=button_4)  # -> out, A; inputs data: list; disabled; same code as txtwriter

digit_scroller_105 = DigitScroller(Scroller_Digits=12, Scroller_Prefix="Digit Scroller", Scroller_Radix=1, Scroller_Value=0.00140149998)  # disabled
number_slider_24 = Slider(256, range=0..65536)  # disabled
radians_12 = Radians(Degrees=number_3)  # disabled

expression_154 = Expression(O=radians_12, Expression="FORMAT(\"{0:0.00000000000000000000}\",O)")  # disabled
panel_241 = Panel(expression_154)  # disabled
curve_114 = Curve(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)  # disabled
number_36 = Number(number_5)  # disabled

digit_scroller_106 = DigitScroller(Scroller_Digits=12, Scroller_Prefix=" ", Scroller_Radix=7, Scroller_Value=16)  # disabled

number_slider_25 = Slider(1, range=0..1)  # disabled
end_points_17 = EndPoints(Curve=curve_90)  # -> Start, End; disabled
rectangle_2pt_17 = Rectangle2Pt(Plane=PlaneXY(0, 0, 0), PointA=end_points_17.Start, PointB=end_points_17.End, Radius=0)  # -> Rectangle, Length; disabled

series_13 = Series(Start=0, Step=panel_241, Count=number_36)  # disabled
expression_155 = Expression(O=series_13, Expression="FORMAT(\"{0:R}\",O)")  # disabled
panel_242 = Panel(expression_155)  # disabled
bounds_11 = Bounds(Numbers=series_13)  # disabled
expression_156 = Expression(X=number_36, Expression="1/X")  # disabled
duplicate_data_14 = DuplicateData(Data=expression_156, Number=number_36, Order=True)  # disabled

curve_graph_mapper_11 = CurveGraphMapper(Curves=curve_90, Rectangle=rectangle_2pt_17.Rectangle, Values=series_13, Flip=False, Snap=True, TextSize=0.015625)  # -> Mapped, GraphCurves, GraphPoints, ValueLines, ValuePoints, MappedLines, MappedPoints, Boundary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; disabled
graphmapper_11 = GraphMapper(Curve=curve_90, Boundary=rectangle_2pt_17.Rectangle, Numbers=series_13, Input=bounds_11, Output=bounds_11, bobo=False)  # disabled
stream_filter_23 = StreamFilter(Gate=number_slider_23, Stream0=curve_graph_mapper_11.Mapped, Stream1=graphmapper_11)  # disabled

turtle_12 = DotNETVBScriptLEGACY(Forward=duplicate_data_14, Left=stream_filter_23)  # -> Output, Points; inputs Forward: list, Left: list; disabled; same code as turtle

expression_157 = Expression(O=turtle_12.Points, Expression="FORMAT(\"{0:R}\",O)")  # disabled
panel_243 = Panel(expression_157)  # disabled

point_22 = Point(turtle_12.Points)  # disabled
scale_49 = Scale(Geometry=point_22, Center=Point(0, 0, 0), Factor=expr("2^X", digit_scroller_106))  # -> Geometry, Transform; disabled

interpolate_t_12 = InterpolateT(Vertices=scale_49.Geometry, TangentStart=Vector(0.0625, 0, 0), TangentEnd=Vector(0, 0, 0), KnotStyle=2)  # -> Curve, Length, Domain; disabled
evaluate_length_46 = EvaluateLength(Curve=interpolate_t_12.Curve, Length=1, Normalized=True)  # -> Point, Tangent, Parameter; disabled
line_sdl_16 = LineSDL(Start=evaluate_length_46.Point, Direction=evaluate_length_46.Tangent, Length=1)  # disabled
mirror_23 = Mirror(Geometry=interpolate_t_12.Curve, Plane=line_sdl_16)  # -> Geometry, Transform; disabled
join_curves_25 = JoinCurves(Curves=[interpolate_t_12.Curve, mirror_23.Geometry], Preserve=False)  # disabled
evaluate_length_47 = EvaluateLength(Curve=join_curves_25, Length=1, Normalized=True)  # -> Point, Tangent, Parameter; disabled
rotate_13 = Rotate(Geometry=join_curves_25, Angle=3.141592654, Plane=evaluate_length_47.Point)  # -> Geometry, Transform; disabled
join_curves_26 = JoinCurves(Curves=[join_curves_25, rotate_13.Geometry], Preserve=False)  # disabled
curve_115 = Curve(join_curves_26)  # disabled

evaluate_length_48 = EvaluateLength(Curve=join_curves_26, Length=1, Normalized=True)  # -> Point, Tangent, Parameter; disabled
deconstruct_27 = Deconstruct(Point=evaluate_length_48.Point)  # -> XComponent, YComponent, ZComponent; disabled
expression_158 = Expression(O=deconstruct_27.YComponent, Expression="FORMAT(\"{0:R}\",O)")  # disabled
expression_159 = Expression(O=deconstruct_27.XComponent, Expression="FORMAT(\"{0:R}\",O)")  # disabled
expression_160 = Expression(O=deconstruct_27.ZComponent, Expression="FORMAT(\"{0:R}\",O)")  # disabled
panel_244 = Panel(expression_158)  # disabled
panel_245 = Panel(expression_159)  # disabled
panel_246 = Panel(expression_160)  # disabled
addition_12 = Addition(A=panel_244, B=panel_245)  # disabled
expression_161 = Expression(O=addition_12, Expression="FORMAT(\"{0:R}\",O)")  # disabled
panel_247 = Panel(expression_161)  # disabled
division_23 = Division(A=panel_247, B=2)  # disabled
expression_162 = Expression(O=division_23, Expression="FORMAT(\"{0:R}\",O)")  # disabled
panel_248 = Panel(expression_162)  # disabled
scale_50 = Scale(Geometry=scale_49.Geometry, Center=Point(0, 0, 0), Factor=expr("1/X", panel_248))  # -> Geometry, Transform; disabled
scale_51 = Scale(Geometry=curve_115, Center=Point(0, 0, 0), Factor=expr("1/X", panel_248))  # -> Geometry, Transform; disabled
evaluate_length_49 = EvaluateLength(Curve=scale_51.Geometry, Length=1, Normalized=True)  # -> Point, Tangent, Parameter; disabled
deconstruct_28 = Deconstruct(Point=evaluate_length_49.Point)  # -> XComponent, YComponent, ZComponent; disabled
expression_163 = Expression(O=deconstruct_28.YComponent, Expression="FORMAT(\"{0:R}\",O)")  # disabled
expression_164 = Expression(O=deconstruct_28.XComponent, Expression="FORMAT(\"{0:R}\",O)")  # disabled
expression_165 = Expression(O=deconstruct_28.ZComponent, Expression="FORMAT(\"{0:R}\",O)")  # disabled
panel_249 = Panel(expression_163)  # disabled
panel_250 = Panel(expression_164)  # disabled
panel_251 = Panel(expression_165)  # disabled
division_24 = Division(A=panel_245, B=panel_244)  # disabled
expression_166 = Expression(O=division_24, Expression="FORMAT(\"{0:R}\",O)")  # disabled
panel_252 = Panel(expression_166)  # disabled
curve_116 = Curve(scale_51.Geometry)  # disabled
point_23 = Point(scale_50.Geometry)  # disabled

move_20 = Move(Geometry=curve_116, Motion=Vector(15, 0, 0))  # -> Geometry, Transform; disabled
mirror_24 = Mirror(Geometry=curve_116, Plane=PlaneYZ(0, 0, 0))  # -> Geometry, Transform; disabled
curve_117 = Curve(move_20.Geometry)  # disabled

vector_xyz_10 = VectorXYZ(XComponent=15, YComponent=1.5, ZComponent=0)  # -> Vector, Length; disabled
curve_118 = Curve(curve_116)  # disabled
end_points_18 = EndPoints(Curve=curve_118)  # -> Start, End; disabled
rectangle_2pt_18 = Rectangle2Pt(Plane=PlaneXY(0, 0, 0), PointA=end_points_18.Start, PointB=end_points_18.End, Radius=0)  # -> Rectangle, Length; disabled
deconstuct_rectangle_7 = DeconstuctRectangle(Rectangle=rectangle_2pt_18.Rectangle)  # -> BasePlane, XInterval, YInterval; disabled
deconstruct_domain_15 = DeconstructDomain(Domain=deconstuct_rectangle_7.YInterval)  # -> Start, End; disabled
deconstruct_domain_16 = DeconstructDomain(Domain=deconstuct_rectangle_7.XInterval)  # -> Start, End; disabled
scale_nu_7 = ScaleNU(
    Geometry=curve_116,
    Plane=PlaneXY(0, 0, 0),
    ScaleX=expr("1/X", deconstruct_domain_16.End),
    ScaleY=expr("1/X", deconstruct_domain_15.End),
    ScaleZ=1)  # -> Geometry, Transform; disabled
curve_119 = Curve(scale_nu_7.Geometry)  # disabled
move_21 = Move(Geometry=curve_119, Motion=vector_xyz_10.Vector)  # -> Geometry, Transform; disabled
curve_120 = Curve(move_21.Geometry)  # disabled

digit_scroller_107 = DigitScroller(Scroller_Digits=12, Scroller_Prefix=" ", Scroller_Radix=2, Scroller_Value=0)  # disabled
stream_filter_24 = StreamFilter(Gate=number_slider_22, Stream0=curve_116, Stream1=curve_119)  # disabled
curve_121 = Curve(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)  # disabled
curve_122 = Curve(stream_filter_24)  # disabled
scale_52 = Scale(Geometry=curve_122, Center=Point(0, 0, 0), Factor=expr("2^X", number))  # -> Geometry, Transform; disabled
curve_123 = Curve(scale_52.Geometry)  # disabled
curve_124 = Curve(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)  # disabled

digit_scroller_108 = DigitScroller(Scroller_Digits=12, Scroller_Prefix="Digit Scroller", Scroller_Radix=1, Scroller_Value=0.00140149998)  # disabled
number_slider_26 = Slider(256, range=0..65536)  # disabled
radians_13 = Radians(Degrees=number_3)  # disabled

expression_167 = Expression(O=radians_13, Expression="FORMAT(\"{0:0.00000000000000000000}\",O)")  # disabled
panel_258 = Panel(expression_167)  # disabled
curve_125 = Curve(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)  # disabled
number_37 = Number(number_5)  # disabled

digit_scroller_109 = DigitScroller(Scroller_Digits=12, Scroller_Prefix=" ", Scroller_Radix=7, Scroller_Value=16)  # disabled

number_slider_27 = Slider(1, range=0..1)  # disabled
end_points_19 = EndPoints(Curve=curve_123)  # -> Start, End; disabled
rectangle_2pt_19 = Rectangle2Pt(Plane=PlaneXY(0, 0, 0), PointA=end_points_19.Start, PointB=end_points_19.End, Radius=0)  # -> Rectangle, Length; disabled

series_14 = Series(Start=0, Step=panel_258, Count=number_37)  # disabled
expression_168 = Expression(O=series_14, Expression="FORMAT(\"{0:R}\",O)")  # disabled
panel_259 = Panel(expression_168)  # disabled
bounds_12 = Bounds(Numbers=series_14)  # disabled
expression_169 = Expression(X=number_37, Expression="1/X")  # disabled
duplicate_data_15 = DuplicateData(Data=expression_169, Number=number_37, Order=True)  # disabled

curve_graph_mapper_12 = CurveGraphMapper(Curves=curve_123, Rectangle=rectangle_2pt_19.Rectangle, Values=series_14, Flip=False, Snap=True, TextSize=0.015625)  # -> Mapped, GraphCurves, GraphPoints, ValueLines, ValuePoints, MappedLines, MappedPoints, Boundary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; disabled
graphmapper_12 = GraphMapper(Curve=curve_123, Boundary=rectangle_2pt_19.Rectangle, Numbers=series_14, Input=bounds_12, Output=bounds_12, bobo=False)  # disabled
stream_filter_25 = StreamFilter(Gate=number_slider_23, Stream0=curve_graph_mapper_12.Mapped, Stream1=graphmapper_12)  # disabled

turtle_13 = DotNETVBScriptLEGACY(Forward=duplicate_data_15, Left=stream_filter_25)  # -> Output, Points; inputs Forward: list, Left: list; disabled; same code as turtle

expression_170 = Expression(O=turtle_13.Points, Expression="FORMAT(\"{0:R}\",O)")  # disabled
panel_260 = Panel(expression_170)  # disabled

point_24 = Point(turtle_13.Points)  # disabled
scale_53 = Scale(Geometry=point_24, Center=Point(0, 0, 0), Factor=expr("2^X", digit_scroller_109))  # -> Geometry, Transform; disabled

interpolate_t_13 = InterpolateT(Vertices=scale_53.Geometry, TangentStart=Vector(0.0625, 0, 0), TangentEnd=Vector(0, 0, 0), KnotStyle=2)  # -> Curve, Length, Domain; disabled
evaluate_length_50 = EvaluateLength(Curve=interpolate_t_13.Curve, Length=1, Normalized=True)  # -> Point, Tangent, Parameter; disabled
line_sdl_17 = LineSDL(Start=evaluate_length_50.Point, Direction=evaluate_length_50.Tangent, Length=1)  # disabled
mirror_25 = Mirror(Geometry=interpolate_t_13.Curve, Plane=line_sdl_17)  # -> Geometry, Transform; disabled
join_curves_27 = JoinCurves(Curves=[interpolate_t_13.Curve, mirror_25.Geometry], Preserve=False)  # disabled
evaluate_length_51 = EvaluateLength(Curve=join_curves_27, Length=1, Normalized=True)  # -> Point, Tangent, Parameter; disabled
rotate_14 = Rotate(Geometry=join_curves_27, Angle=3.141592654, Plane=evaluate_length_51.Point)  # -> Geometry, Transform; disabled
join_curves_28 = JoinCurves(Curves=[join_curves_27, rotate_14.Geometry], Preserve=False)  # disabled
curve_126 = Curve(join_curves_28)  # disabled

evaluate_length_52 = EvaluateLength(Curve=join_curves_28, Length=1, Normalized=True)  # -> Point, Tangent, Parameter; disabled
deconstruct_29 = Deconstruct(Point=evaluate_length_52.Point)  # -> XComponent, YComponent, ZComponent; disabled
expression_171 = Expression(O=deconstruct_29.YComponent, Expression="FORMAT(\"{0:R}\",O)")  # disabled
expression_172 = Expression(O=deconstruct_29.XComponent, Expression="FORMAT(\"{0:R}\",O)")  # disabled
expression_173 = Expression(O=deconstruct_29.ZComponent, Expression="FORMAT(\"{0:R}\",O)")  # disabled
panel_261 = Panel(expression_171)  # disabled
panel_262 = Panel(expression_172)  # disabled
panel_263 = Panel(expression_173)  # disabled
addition_13 = Addition(A=panel_261, B=panel_262)  # disabled
expression_174 = Expression(O=addition_13, Expression="FORMAT(\"{0:R}\",O)")  # disabled
panel_264 = Panel(expression_174)  # disabled
division_25 = Division(A=panel_264, B=2)  # disabled
expression_175 = Expression(O=division_25, Expression="FORMAT(\"{0:R}\",O)")  # disabled
panel_265 = Panel(expression_175)  # disabled
scale_54 = Scale(Geometry=scale_53.Geometry, Center=Point(0, 0, 0), Factor=expr("1/X", panel_265))  # -> Geometry, Transform; disabled
scale_55 = Scale(Geometry=curve_126, Center=Point(0, 0, 0), Factor=expr("1/X", panel_265))  # -> Geometry, Transform; disabled
evaluate_length_53 = EvaluateLength(Curve=scale_55.Geometry, Length=1, Normalized=True)  # -> Point, Tangent, Parameter; disabled
deconstruct_30 = Deconstruct(Point=evaluate_length_53.Point)  # -> XComponent, YComponent, ZComponent; disabled
expression_176 = Expression(O=deconstruct_30.YComponent, Expression="FORMAT(\"{0:R}\",O)")  # disabled
expression_177 = Expression(O=deconstruct_30.XComponent, Expression="FORMAT(\"{0:R}\",O)")  # disabled
expression_178 = Expression(O=deconstruct_30.ZComponent, Expression="FORMAT(\"{0:R}\",O)")  # disabled
panel_266 = Panel(expression_176)  # disabled
panel_267 = Panel(expression_177)  # disabled
panel_268 = Panel(expression_178)  # disabled
division_26 = Division(A=panel_262, B=panel_261)  # disabled
expression_179 = Expression(O=division_26, Expression="FORMAT(\"{0:R}\",O)")  # disabled
panel_269 = Panel(expression_179)  # disabled
curve_127 = Curve(scale_55.Geometry)  # disabled
point_25 = Point(scale_54.Geometry)  # disabled

move_22 = Move(Geometry=curve_127, Motion=Vector(17.5, 0, 0))  # -> Geometry, Transform; disabled
mirror_26 = Mirror(Geometry=curve_127, Plane=PlaneYZ(0, 0, 0))  # -> Geometry, Transform; disabled
curve_128 = Curve(move_22.Geometry)  # disabled

entwine = Entwine(
    Branch0X=curve_34,
    Branch1X=curve_44,
    Branch2X=curve_54,
    Branch3X=curve_64,
    Branch4X=curve_74,
    Branch5X=curve_84,
    Branch6X=curve_117,
    Branch7X=curve_128,
    FlattenInputs=False)

vector_xyz_11 = VectorXYZ(XComponent=17.5, YComponent=1.5, ZComponent=0)  # -> Vector, Length; disabled
curve_129 = Curve(curve_127)  # disabled
end_points_20 = EndPoints(Curve=curve_129)  # -> Start, End; disabled
rectangle_2pt_20 = Rectangle2Pt(Plane=PlaneXY(0, 0, 0), PointA=end_points_20.Start, PointB=end_points_20.End, Radius=0)  # -> Rectangle, Length; disabled
deconstuct_rectangle_8 = DeconstuctRectangle(Rectangle=rectangle_2pt_20.Rectangle)  # -> BasePlane, XInterval, YInterval; disabled
deconstruct_domain_17 = DeconstructDomain(Domain=deconstuct_rectangle_8.YInterval)  # -> Start, End; disabled
deconstruct_domain_18 = DeconstructDomain(Domain=deconstuct_rectangle_8.XInterval)  # -> Start, End; disabled
scale_nu_8 = ScaleNU(
    Geometry=curve_127,
    Plane=PlaneXY(0, 0, 0),
    ScaleX=expr("1/X", deconstruct_domain_18.End),
    ScaleY=expr("1/X", deconstruct_domain_17.End),
    ScaleZ=1)  # -> Geometry, Transform; disabled
curve_130 = Curve(scale_nu_8.Geometry)  # disabled
move_23 = Move(Geometry=curve_130, Motion=vector_xyz_11.Vector)  # -> Geometry, Transform; disabled
curve_131 = Curve(move_23.Geometry)  # disabled

entwine_2 = Entwine(
    Branch0X=curve_39,
    Branch1X=curve_47,
    Branch2X=curve_57,
    Branch3X=curve_67,
    Branch4X=curve_77,
    Branch5X=curve_87,
    Branch6X=curve_120,
    Branch7X=curve_131,
    FlattenInputs=False)
entwine_3 = Entwine(Branch0X=entwine_2, Branch1X=entwine, FlattenInputs=False)

digit_scroller_110 = DigitScroller(Scroller_Digits=12, Scroller_Prefix=" ", Scroller_Radix=2, Scroller_Value=30.9312132)  # disabled
stream_filter_26 = StreamFilter(Gate=number_slider_22, Stream0=curve_127, Stream1=curve_130)  # disabled
curve_132 = Curve(stream_filter_26)  # disabled
scale_56 = Scale(Geometry=curve_132, Center=Point(0, 0, 0), Factor=expr("2^X", number))  # -> Geometry, Transform; disabled
curve_133 = Curve(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)  # disabled
curve_134 = Curve(scale_56.Geometry)  # disabled
curve_135 = Curve(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)  # disabled

digit_scroller_111 = DigitScroller(Scroller_Digits=12, Scroller_Prefix="Digit Scroller", Scroller_Radix=1, Scroller_Value=0.00140149998)  # disabled
radians_14 = Radians(Degrees=digit_scroller_104)  # disabled
number_slider_28 = Slider(256, range=0..65536)  # disabled

expression_180 = Expression(O=radians_14, Expression="FORMAT(\"{0:0.00000000000000000000}\",O)")  # disabled
panel_274 = Panel(expression_180)  # disabled
curve_136 = Curve(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)  # disabled
number_38 = Number(number_5)  # disabled

digit_scroller_112 = DigitScroller(Scroller_Digits=12, Scroller_Prefix=" ", Scroller_Radix=7, Scroller_Value=16)  # disabled

deconstruct_vector = DeconstructVector(Vector=vector_xyz_11.Vector)  # -> XComponent, YComponent, ZComponent; disabled
vector_xyz_12 = VectorXYZ(
    XComponent=deconstruct_vector.XComponent,
    YComponent=expr("X+2.5", deconstruct_vector.YComponent),
    ZComponent=deconstruct_vector.ZComponent)  # -> Vector, Length; disabled

number_slider_29 = Slider(1, range=0..1)  # disabled
end_points_21 = EndPoints(Curve=curve_134)  # -> Start, End; disabled
rectangle_2pt_21 = Rectangle2Pt(Plane=PlaneXY(0, 0, 0), PointA=end_points_21.Start, PointB=end_points_21.End, Radius=0)  # -> Rectangle, Length; disabled

series_15 = Series(Start=0, Step=panel_274, Count=number_38)  # disabled
expression_181 = Expression(O=series_15, Expression="FORMAT(\"{0:R}\",O)")  # disabled
panel_275 = Panel(expression_181)  # disabled
bounds_13 = Bounds(Numbers=series_15)  # disabled
expression_182 = Expression(X=number_38, Expression="1/X")  # disabled
duplicate_data_16 = DuplicateData(Data=expression_182, Number=number_38, Order=True)  # disabled

curve_graph_mapper_13 = CurveGraphMapper(Curves=curve_134, Rectangle=rectangle_2pt_21.Rectangle, Values=series_15, Flip=False, Snap=True, TextSize=0.015625)  # -> Mapped, GraphCurves, GraphPoints, ValueLines, ValuePoints, MappedLines, MappedPoints, Boundary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; disabled
graphmapper_13 = GraphMapper(Curve=curve_134, Boundary=rectangle_2pt_21.Rectangle, Numbers=series_15, Input=bounds_13, Output=bounds_13, bobo=False)  # disabled
stream_filter_27 = StreamFilter(Gate=number_slider_23, Stream0=curve_graph_mapper_13.Mapped, Stream1=graphmapper_13)  # disabled

turtle_14 = DotNETVBScriptLEGACY(Forward=duplicate_data_16, Left=stream_filter_27)  # -> Output, Points; inputs Forward: list, Left: list; disabled; same code as turtle

expression_183 = Expression(O=turtle_14.Points, Expression="FORMAT(\"{0:R}\",O)")  # disabled
panel_276 = Panel(expression_183)  # disabled

point_26 = Point(turtle_14.Points)  # disabled
scale_57 = Scale(Geometry=point_26, Center=Point(0, 0, 0), Factor=expr("2^X", digit_scroller_112))  # -> Geometry, Transform; disabled

interpolate_t_14 = InterpolateT(Vertices=scale_57.Geometry, TangentStart=Vector(0.0625, 0, 0), TangentEnd=Vector(0, 0, 0), KnotStyle=2)  # -> Curve, Length, Domain; disabled
evaluate_length_54 = EvaluateLength(Curve=interpolate_t_14.Curve, Length=1, Normalized=True)  # -> Point, Tangent, Parameter; disabled
line_sdl_18 = LineSDL(Start=evaluate_length_54.Point, Direction=evaluate_length_54.Tangent, Length=1)  # disabled
mirror_27 = Mirror(Geometry=interpolate_t_14.Curve, Plane=line_sdl_18)  # -> Geometry, Transform; disabled
join_curves_29 = JoinCurves(Curves=[interpolate_t_14.Curve, mirror_27.Geometry], Preserve=False)  # disabled
evaluate_length_55 = EvaluateLength(Curve=join_curves_29, Length=1, Normalized=True)  # -> Point, Tangent, Parameter; disabled
rotate_15 = Rotate(Geometry=join_curves_29, Angle=3.141592654, Plane=evaluate_length_55.Point)  # -> Geometry, Transform; disabled
join_curves_30 = JoinCurves(Curves=[join_curves_29, rotate_15.Geometry], Preserve=False)  # disabled
curve_137 = Curve(join_curves_30)  # disabled

evaluate_length_56 = EvaluateLength(Curve=join_curves_30, Length=1, Normalized=True)  # -> Point, Tangent, Parameter; disabled
deconstruct_31 = Deconstruct(Point=evaluate_length_56.Point)  # -> XComponent, YComponent, ZComponent; disabled
expression_184 = Expression(O=deconstruct_31.YComponent, Expression="FORMAT(\"{0:R}\",O)")  # disabled
expression_185 = Expression(O=deconstruct_31.XComponent, Expression="FORMAT(\"{0:R}\",O)")  # disabled
expression_186 = Expression(O=deconstruct_31.ZComponent, Expression="FORMAT(\"{0:R}\",O)")  # disabled
panel_277 = Panel(expression_184)  # disabled
panel_278 = Panel(expression_185)  # disabled
panel_279 = Panel(expression_186)  # disabled
addition_14 = Addition(A=panel_277, B=panel_278)  # disabled
expression_187 = Expression(O=addition_14, Expression="FORMAT(\"{0:R}\",O)")  # disabled
panel_280 = Panel(expression_187)  # disabled
division_27 = Division(A=panel_280, B=2)  # disabled
expression_188 = Expression(O=division_27, Expression="FORMAT(\"{0:R}\",O)")  # disabled
panel_281 = Panel(expression_188)  # disabled
scale_58 = Scale(Geometry=scale_57.Geometry, Center=Point(0, 0, 0), Factor=expr("1/X", panel_281))  # -> Geometry, Transform; disabled
scale_59 = Scale(Geometry=curve_137, Center=Point(0, 0, 0), Factor=expr("1/X", panel_281))  # -> Geometry, Transform; disabled
evaluate_length_57 = EvaluateLength(Curve=scale_59.Geometry, Length=1, Normalized=True)  # -> Point, Tangent, Parameter; disabled
deconstruct_32 = Deconstruct(Point=evaluate_length_57.Point)  # -> XComponent, YComponent, ZComponent; disabled
expression_189 = Expression(O=deconstruct_32.YComponent, Expression="FORMAT(\"{0:R}\",O)")  # disabled
expression_190 = Expression(O=deconstruct_32.XComponent, Expression="FORMAT(\"{0:R}\",O)")  # disabled
expression_191 = Expression(O=deconstruct_32.ZComponent, Expression="FORMAT(\"{0:R}\",O)")  # disabled
panel_282 = Panel(expression_189)  # disabled
panel_283 = Panel(expression_190)  # disabled
panel_284 = Panel(expression_191)  # disabled
division_28 = Division(A=panel_278, B=panel_277)  # disabled
expression_192 = Expression(O=division_28, Expression="FORMAT(\"{0:R}\",O)")  # disabled
panel_285 = Panel(expression_192)  # disabled
curve_138 = Curve(scale_59.Geometry)  # disabled
point_27 = Point(scale_58.Geometry)  # disabled

move_24 = Move(Geometry=curve_138, Motion=vector_xyz_12.Vector)  # -> Geometry, Transform; disabled
mirror_28 = Mirror(Geometry=curve_138, Plane=PlaneYZ(0, 0, 0))  # -> Geometry, Transform; disabled
curve_139 = Curve(move_24.Geometry)  # disabled

entwine_4 = Entwine(
    Branch0X=curve_139,
    Branch1X=curve_94,
    Branch2X=curve_98,
    Branch3X=curve_101,
    Branch4X=curve_104,
    Branch5X=curve_112,
    FlattenInputs=False)
entwine_5 = Entwine(Branch0X=entwine_4, Branch1X=entwine_3, Branch2X=interpolate.Curve, FlattenInputs=False)
curve_140 = Curve(graft(entwine_5))

evaluate_length_58 = EvaluateLength(Curve=curve_140, Length=1, Normalized=True)  # -> Point, Tangent, Parameter
deconstruct_33 = Deconstruct(Point=evaluate_length_58.Point)  # -> XComponent, YComponent, ZComponent
scale_nu_9 = ScaleNU(
    Geometry=curve_140,
    Plane=PlaneXY(0, 0, 0),
    ScaleX=expr("1/X", deconstruct_33.XComponent),
    ScaleY=expr("1/X", deconstruct_33.YComponent),
    ScaleZ=1)  # -> Geometry, Transform

curve_141 = Curve(graft(curve_140))
divide_curve_5 = DivideCurve(Curve=curve_141, Count=number_23, Kinks=False)  # -> Points, Tangents, Parameters
curvature = Curvature(Curve=curve_141, Parameter=divide_curve_5.Parameters)  # -> Point, Curvature, Curvature_2
deconstruct_arc = DeconstructArc(Arc=curvature.Curvature_2)  # -> BasePlane, Radius, Angle
line = Line(StartPoint=curvature.Point, EndPoint=deconstruct_arc.BasePlane)
length = Length(Curve=curve_141)
one_over_x = OneOverX(Value=deconstruct_arc.Radius)
expression_193 = Expression(O=one_over_x, Expression="FORMAT(\"{0:R}\",O)")  # disabled
panel_287 = Panel(expression_193)
quick_graph = QuickGraph(one_over_x, SortOrder=0)
bounds_14 = Bounds(Numbers=one_over_x)
remap_numbers = RemapNumbers(Value=one_over_x, Source=bounds_14, Target=Domain(0, 1))  # -> Mapped, Clipped
multiplication = Multiplication(A=length, B=remap_numbers.Mapped)
multiplication_2 = Multiplication(A=multiplication, B=digit_scroller_76)
line_sdl_19 = LineSDL(Start=curvature.Point, Direction=curvature.Curvature, Length=expr("-X", multiplication_2))
evaluate_length_59 = EvaluateLength(Curve=line_sdl_19, Length=1, Normalized=True)  # -> Point, Tangent, Parameter
interpolate_2 = Interpolate(Vertices=evaluate_length_59.Point, Degree=1, Periodic=False, KnotStyle=2)  # -> Curve, Length, Domain
custom_preview = CustomPreview(Geometry=line_sdl_19, Material=create_material_41)
custom_preview_2 = CustomPreview(Geometry=curve_141, Material=create_material_42)
curvature_graph = CurvatureGraph(Curve=curve_141, Density=1, Scale=digit_scroller_75)  # disabled
curve_142 = Curve(interpolate_2.Curve)
custom_preview_3 = CustomPreview(Geometry=curve_142, Material=create_material_40)

expression_194 = Expression(O=deconstruct_arc.Radius, Expression="FORMAT(\"{0:R}\",O)")  # disabled
panel_288 = Panel(expression_194)

replace_nulls = ReplaceNulls(Items=one_over_x, Replacements=0)  # -> Items, Count
relative_differences = RelativeDifferences(Values=replace_nulls.Items)
list_length_4 = ListLength(List=relative_differences)
series_16 = Series(Start=1, Step=1, Count=expr("X-1", list_length_4))
list_item_2 = ListItem(List=relative_differences, Index=series_16, Wrap=False)

expression_195 = Expression(O=list_item_2, Expression="FORMAT(\"{0:R}\",O)")  # disabled
panel_289 = Panel(expression_195)

replace_nulls_2 = ReplaceNulls(Items=list_item_2, Replacements=0)  # -> Items, Count
relative_differences_2 = RelativeDifferences(Values=replace_nulls_2.Items)
list_length_5 = ListLength(List=relative_differences_2)
series_17 = Series(Start=1, Step=1, Count=expr("X-1", list_length_5))
list_item_3 = ListItem(List=relative_differences_2, Index=series_17, Wrap=False)

expression_196 = Expression(O=list_item_3, Expression="FORMAT(\"{0:R}\",O)")  # disabled
panel_290 = Panel(expression_196)

replace_nulls_3 = ReplaceNulls(Items=list_item_3, Replacements=0)  # -> Items, Count
relative_differences_3 = RelativeDifferences(Values=replace_nulls_3.Items)
list_length_6 = ListLength(List=relative_differences_3)
series_18 = Series(Start=1, Step=1, Count=expr("X-1", list_length_6))
list_item_4 = ListItem(List=relative_differences_3, Index=series_18, Wrap=False)

expression_197 = Expression(O=list_item_4, Expression="FORMAT(\"{0:R}\",O)")  # disabled
panel_291 = Panel(expression_197)

replace_nulls_4 = ReplaceNulls(Items=list_item_4, Replacements=0)  # -> Items, Count
relative_differences_4 = RelativeDifferences(Values=replace_nulls_4.Items)
list_length_7 = ListLength(List=relative_differences_4)
series_19 = Series(Start=1, Step=1, Count=expr("X-1", list_length_7))
list_item_5 = ListItem(List=relative_differences_4, Index=series_19, Wrap=False)

expression_198 = Expression(O=list_item_5, Expression="FORMAT(\"{0:R}\",O)")  # disabled
panel_292 = Panel(expression_198)

replace_nulls_5 = ReplaceNulls(Items=list_item_5, Replacements=0)  # -> Items, Count
relative_differences_5 = RelativeDifferences(Values=replace_nulls_5.Items)
list_length_8 = ListLength(List=relative_differences_5)
series_20 = Series(Start=1, Step=1, Count=expr("X-1", list_length_8))
list_item_6 = ListItem(List=relative_differences_5, Index=series_20, Wrap=False)

expression_199 = Expression(O=list_item_6, Expression="FORMAT(\"{0:R}\",O)")  # disabled
panel_293 = Panel(expression_199)

replace_nulls_6 = ReplaceNulls(Items=list_item_6, Replacements=0)  # -> Items, Count
relative_differences_6 = RelativeDifferences(Values=replace_nulls_6.Items)
list_length_9 = ListLength(List=relative_differences_6)
series_21 = Series(Start=1, Step=1, Count=expr("X-1", list_length_9))
list_item_7 = ListItem(List=relative_differences_6, Index=series_21, Wrap=False)

expression_200 = Expression(O=list_item_7, Expression="FORMAT(\"{0:R}\",O)")  # disabled
panel_294 = Panel(expression_200)

replace_nulls_7 = ReplaceNulls(Items=list_item_7, Replacements=0)  # -> Items, Count
relative_differences_7 = RelativeDifferences(Values=replace_nulls_7.Items)
list_length_10 = ListLength(List=relative_differences_7)
series_22 = Series(Start=1, Step=1, Count=expr("X-1", list_length_10))
list_item_8 = ListItem(List=relative_differences_7, Index=series_22, Wrap=False)

expression_201 = Expression(O=list_item_8, Expression="FORMAT(\"{0:R}\",O)")  # disabled
panel_295 = Panel(expression_201)

explode = Explode(Curve=curve_142, Recursive=True)  # -> Segments, Vertices
evaluate_length_60 = EvaluateLength(Curve=explode.Segments, Length=0.5, Normalized=True)  # -> Point, Tangent, Parameter
curve_closest_point = CurveClosestPoint(Point=evaluate_length_60.Point, Curve=curve_141)  # -> Point, Parameter, Distance
line_2 = Line(StartPoint=curve_closest_point.Point, EndPoint=evaluate_length_60.Point)

bounds_15 = Bounds(Numbers=list_item_8)
remap_numbers_2 = RemapNumbers(Value=list_item_8, Source=bounds_15, Target=Domain(-1, 1))  # -> Mapped, Clipped
multiplication_3 = Multiplication(A=length, B=remap_numbers_2.Mapped)
multiplication_4 = Multiplication(A=multiplication_3, B=digit_scroller_77)

bounds_16 = Bounds(Numbers=list_item_7)
remap_numbers_3 = RemapNumbers(Value=list_item_7, Source=bounds_16, Target=Domain(-1, 1))  # -> Mapped, Clipped
multiplication_5 = Multiplication(A=length, B=remap_numbers_3.Mapped)
multiplication_6 = Multiplication(A=multiplication_5, B=digit_scroller_72)

bounds_17 = Bounds(Numbers=list_item_6)
remap_numbers_4 = RemapNumbers(Value=list_item_6, Source=bounds_17, Target=Domain(-1, 1))  # -> Mapped, Clipped
multiplication_7 = Multiplication(A=length, B=remap_numbers_4.Mapped)
multiplication_8 = Multiplication(A=multiplication_7, B=digit_scroller_78)

bounds_18 = Bounds(Numbers=list_item_5)
remap_numbers_5 = RemapNumbers(Value=list_item_5, Source=bounds_18, Target=Domain(-1, 1))  # -> Mapped, Clipped
multiplication_9 = Multiplication(A=length, B=remap_numbers_5.Mapped)
multiplication_10 = Multiplication(A=multiplication_9, B=digit_scroller_73)

bounds_19 = Bounds(Numbers=list_item_4)
remap_numbers_6 = RemapNumbers(Value=list_item_4, Source=bounds_19, Target=Domain(-1, 1))  # -> Mapped, Clipped
multiplication_11 = Multiplication(A=length, B=remap_numbers_6.Mapped)
multiplication_12 = Multiplication(A=multiplication_11, B=digit_scroller_79)

bounds_20 = Bounds(Numbers=list_item_3)
remap_numbers_7 = RemapNumbers(Value=list_item_3, Source=bounds_20, Target=Domain(-1, 1))  # -> Mapped, Clipped
multiplication_13 = Multiplication(A=length, B=remap_numbers_7.Mapped)
multiplication_14 = Multiplication(A=multiplication_13, B=digit_scroller_80)

bounds_21 = Bounds(Numbers=list_item_2)
remap_numbers_8 = RemapNumbers(Value=list_item_2, Source=bounds_21, Target=Domain(-1, 1))  # -> Mapped, Clipped
multiplication_15 = Multiplication(A=length, B=remap_numbers_8.Mapped)
multiplication_16 = Multiplication(A=multiplication_15, B=digit_scroller_81)

quick_graph_2 = QuickGraph(list_item_2, SortOrder=0)
line_sdl_20 = LineSDL(Start=evaluate_length_60.Point, Direction=line_2, Length=expr("ABS(X)", multiplication_16))
evaluate_length_61 = EvaluateLength(Curve=line_sdl_20, Length=1, Normalized=True)  # -> Point, Tangent, Parameter
interpolate_3 = Interpolate(Vertices=evaluate_length_61.Point, Degree=1, Periodic=False, KnotStyle=2)  # -> Curve, Length, Domain
custom_preview_4 = CustomPreview(Geometry=interpolate_3.Curve, Material=create_material_55)
custom_preview_5 = CustomPreview(Geometry=line_sdl_20, Material=create_material_56)

explode_2 = Explode(Curve=interpolate_3.Curve, Recursive=True)  # -> Segments, Vertices
evaluate_length_62 = EvaluateLength(Curve=explode_2.Segments, Length=0.5, Normalized=True)  # -> Point, Tangent, Parameter
curve_closest_point_2 = CurveClosestPoint(Point=evaluate_length_62.Point, Curve=curve_141)  # -> Point, Parameter, Distance
line_3 = Line(StartPoint=curve_closest_point_2.Point, EndPoint=evaluate_length_62.Point)

quick_graph_3 = QuickGraph(list_item_3, SortOrder=0)
line_sdl_21 = LineSDL(Start=evaluate_length_62.Point, Direction=line_3, Length=expr("ABS(X)", multiplication_14))
evaluate_length_63 = EvaluateLength(Curve=line_sdl_21, Length=1, Normalized=True)  # -> Point, Tangent, Parameter
interpolate_4 = Interpolate(Vertices=evaluate_length_63.Point, Degree=1, Periodic=False, KnotStyle=2)  # -> Curve, Length, Domain
custom_preview_6 = CustomPreview(Geometry=interpolate_4.Curve, Material=create_material_53)
custom_preview_7 = CustomPreview(Geometry=line_sdl_21, Material=create_material_54)

explode_3 = Explode(Curve=interpolate_4.Curve, Recursive=True)  # -> Segments, Vertices
evaluate_length_64 = EvaluateLength(Curve=explode_3.Segments, Length=0.5, Normalized=True)  # -> Point, Tangent, Parameter
curve_closest_point_3 = CurveClosestPoint(Point=evaluate_length_64.Point, Curve=curve_141)  # -> Point, Parameter, Distance
line_4 = Line(StartPoint=curve_closest_point_3.Point, EndPoint=evaluate_length_64.Point)

quick_graph_4 = QuickGraph(list_item_4, SortOrder=0)
line_sdl_22 = LineSDL(Start=evaluate_length_64.Point, Direction=line_4, Length=expr("ABS(X)", multiplication_12))
evaluate_length_65 = EvaluateLength(Curve=line_sdl_22, Length=1, Normalized=True)  # -> Point, Tangent, Parameter
interpolate_5 = Interpolate(Vertices=evaluate_length_65.Point, Degree=1, Periodic=False, KnotStyle=2)  # -> Curve, Length, Domain
custom_preview_8 = CustomPreview(Geometry=interpolate_5.Curve, Material=create_material_51)
custom_preview_9 = CustomPreview(Geometry=line_sdl_22, Material=create_material_52)

explode_4 = Explode(Curve=interpolate_5.Curve, Recursive=True)  # -> Segments, Vertices
evaluate_length_66 = EvaluateLength(Curve=explode_4.Segments, Length=0.5, Normalized=True)  # -> Point, Tangent, Parameter
curve_closest_point_4 = CurveClosestPoint(Point=evaluate_length_66.Point, Curve=curve_141)  # -> Point, Parameter, Distance
line_5 = Line(StartPoint=curve_closest_point_4.Point, EndPoint=evaluate_length_66.Point)

quick_graph_5 = QuickGraph(list_item_5, SortOrder=0)
line_sdl_23 = LineSDL(Start=evaluate_length_66.Point, Direction=line_5, Length=expr("ABS(X)", multiplication_10))
evaluate_length_67 = EvaluateLength(Curve=line_sdl_23, Length=1, Normalized=True)  # -> Point, Tangent, Parameter
interpolate_6 = Interpolate(Vertices=evaluate_length_67.Point, Degree=1, Periodic=False, KnotStyle=2)  # -> Curve, Length, Domain
custom_preview_10 = CustomPreview(Geometry=interpolate_6.Curve, Material=create_material_49)
custom_preview_11 = CustomPreview(Geometry=line_sdl_23, Material=create_material_50)

explode_5 = Explode(Curve=interpolate_6.Curve, Recursive=True)  # -> Segments, Vertices
evaluate_length_68 = EvaluateLength(Curve=explode_5.Segments, Length=0.5, Normalized=True)  # -> Point, Tangent, Parameter
curve_closest_point_5 = CurveClosestPoint(Point=evaluate_length_68.Point, Curve=curve_141)  # -> Point, Parameter, Distance
line_6 = Line(StartPoint=curve_closest_point_5.Point, EndPoint=evaluate_length_68.Point)

quick_graph_6 = QuickGraph(list_item_6, SortOrder=0)
line_sdl_24 = LineSDL(Start=evaluate_length_68.Point, Direction=line_6, Length=expr("ABS(X)", multiplication_8))
evaluate_length_69 = EvaluateLength(Curve=line_sdl_24, Length=1, Normalized=True)  # -> Point, Tangent, Parameter
interpolate_7 = Interpolate(Vertices=evaluate_length_69.Point, Degree=1, Periodic=False, KnotStyle=2)  # -> Curve, Length, Domain
custom_preview_12 = CustomPreview(Geometry=interpolate_7.Curve, Material=create_material_47)
custom_preview_13 = CustomPreview(Geometry=line_sdl_24, Material=create_material_48)

explode_6 = Explode(Curve=interpolate_7.Curve, Recursive=True)  # -> Segments, Vertices
evaluate_length_70 = EvaluateLength(Curve=explode_6.Segments, Length=0.5, Normalized=True)  # -> Point, Tangent, Parameter
curve_closest_point_6 = CurveClosestPoint(Point=evaluate_length_70.Point, Curve=curve_141)  # -> Point, Parameter, Distance
line_7 = Line(StartPoint=curve_closest_point_6.Point, EndPoint=evaluate_length_70.Point)

quick_graph_7 = QuickGraph(list_item_7, SortOrder=0)
line_sdl_25 = LineSDL(Start=evaluate_length_70.Point, Direction=line_7, Length=expr("ABS(X)", multiplication_6))
evaluate_length_71 = EvaluateLength(Curve=line_sdl_25, Length=1, Normalized=True)  # -> Point, Tangent, Parameter
interpolate_8 = Interpolate(Vertices=evaluate_length_71.Point, Degree=1, Periodic=False, KnotStyle=2)  # -> Curve, Length, Domain
custom_preview_14 = CustomPreview(Geometry=interpolate_8.Curve, Material=create_material_45)
custom_preview_15 = CustomPreview(Geometry=line_sdl_25, Material=create_material_46)

explode_7 = Explode(Curve=interpolate_8.Curve, Recursive=True)  # -> Segments, Vertices
evaluate_length_72 = EvaluateLength(Curve=explode_7.Segments, Length=0.5, Normalized=True)  # -> Point, Tangent, Parameter
curve_closest_point_7 = CurveClosestPoint(Point=evaluate_length_72.Point, Curve=curve_141)  # -> Point, Parameter, Distance
line_8 = Line(StartPoint=curve_closest_point_7.Point, EndPoint=evaluate_length_72.Point)

quick_graph_8 = QuickGraph(list_item_8, SortOrder=0)
line_sdl_26 = LineSDL(Start=evaluate_length_72.Point, Direction=line_8, Length=expr("ABS(X)", multiplication_4))
evaluate_length_73 = EvaluateLength(Curve=line_sdl_26, Length=1, Normalized=True)  # -> Point, Tangent, Parameter
interpolate_9 = Interpolate(Vertices=evaluate_length_73.Point, Degree=1, Periodic=False, KnotStyle=2)  # -> Curve, Length, Domain
custom_preview_16 = CustomPreview(Geometry=interpolate_9.Curve, Material=create_material_43)
custom_preview_17 = CustomPreview(Geometry=line_sdl_26, Material=create_material_44)

curve_143 = Curve(curve_141)  # disabled
divide_curve_6 = DivideCurve(Curve=curve_143, Count=number_25, Kinks=False)  # -> Points, Tangents, Parameters; disabled
deconstruct_34 = Deconstruct(Point=divide_curve_6.Points)  # -> graft(XComponent), graft(YComponent), ZComponent; disabled
expression_202 = Expression(X=deconstruct_34.XComponent, Expression="FORMAT(\"{0:R}\",ROUND(X, 15))")  # -> simplify(Result); disabled
expression_203 = Expression(Y=deconstruct_34.YComponent, Expression="FORMAT(\"{0:R}\",ROUND(Y, 15))")  # -> simplify(Result); disabled
expression_204 = Expression(Y=deconstruct_34.YComponent, Expression="FORMAT(\"{0:R}\",Y)")  # -> simplify(Result); disabled
expression_205 = Expression(X=deconstruct_34.XComponent, Expression="FORMAT(\"{0:R}\",X)")  # -> simplify(Result); disabled
panel_296 = Panel(expression_205)  # disabled
panel_297 = Panel(expression_204)  # disabled
curvature_2 = Curvature(Curve=curve_143, Parameter=divide_curve_6.Parameters)  # -> Point, Curvature, Curvature_2; disabled
deconstruct_arc_2 = DeconstructArc(Arc=curvature_2.Curvature_2)  # -> BasePlane, Radius, Angle; disabled
one_over_x_2 = OneOverX(Value=deconstruct_arc_2.Radius)  # -> graft(Result); disabled
expression_206 = Expression(X=one_over_x_2, Expression="FORMAT(\"{0:R}\",X)")  # -> simplify(Result); disabled
list_length_11 = ListLength(List=divide_curve_6.Points)  # disabled
duplicate_data_17 = DuplicateData(Data=",", Number=list_length_11, Order=True)  # -> simplify(graft(Data)); disabled
panel_298 = Panel(duplicate_data_17)  # disabled
panel_299 = Panel(duplicate_data_17)  # disabled
panel_300 = Panel(expression_206)  # disabled
concatenate_3 = Concatenate(FragmentA=panel_296, FragmentB=panel_298, FragmentA_2=panel_297, FragmentA_3=panel_299, FragmentB_2=panel_300)  # -> flatten(Result); disabled
panel_301 = Panel(concatenate_3)  # disabled
txtwriter_4 = VBScript(filePath=file_path, data=flatten(panel_301), activate=button)  # -> out, A; inputs data: list; disabled; same code as txtwriter

curve_144 = Curve(entwine_4)
curve_145 = Curve(entwine_5)

curve_146 = Curve(graft(curve_140))  # disabled
divide_curve_7 = DivideCurve(Curve=curve_146, Count=number_9, Kinks=False)  # -> Points, Tangents, Parameters; disabled
curvature_3 = Curvature(Curve=curve_146, Parameter=divide_curve_7.Parameters)  # -> Point, Curvature, Curvature_2; disabled
deconstruct_arc_3 = DeconstructArc(Arc=curvature_3.Curvature_2)  # -> BasePlane, Radius, Angle; disabled
expression_207 = Expression(O=deconstruct_arc_3.Radius, Expression="FORMAT(\"{0:R}\",O)")  # disabled
panel_302 = Panel(expression_207)  # disabled
quick_graph_9 = QuickGraph(deconstruct_arc_3.Radius, SortOrder=0)  # disabled
one_over_x_3 = OneOverX(Value=deconstruct_arc_3.Radius)  # disabled

expression_208 = Expression(O=one_over_x_3, Expression="FORMAT(\"{0:R}\",O)")  # disabled
panel_303 = Panel(expression_208)  # disabled

quick_graph_10 = QuickGraph(one_over_x_3, SortOrder=0)  # disabled
multiplication_17 = Multiplication(A=one_over_x_3, B=digit_scroller_39)  # disabled
line_sdl_27 = LineSDL(Start=divide_curve.Points, Direction=Vector(0, 1, 0), Length=multiplication_17)  # disabled

replace_nulls_8 = ReplaceNulls(Items=one_over_x_3, Replacements=0)  # -> Items, Count; disabled
relative_differences_8 = RelativeDifferences(Values=replace_nulls_8.Items)  # disabled

curve_147 = Curve(line_sdl_27)  # disabled

list_length_12 = ListLength(List=curve_146)  # -> flatten(Length); disabled
mass_addition = MassAddition(Input=list_length_12)  # -> Result, PartialResults; disabled
panel_304 = Panel(mass_addition.Result)  # disabled
series_23 = Series(Start=1, Step=1, Count=panel_304)  # -> graft(Series); disabled
vector_xyz_13 = VectorXYZ(XComponent=expr("-X", series_23), YComponent=0, ZComponent=0)  # -> Vector, Length; disabled
move_25 = Move(Geometry=curve_147, Motion=vector_xyz_13.Vector)  # -> Geometry, Transform; disabled
evaluate_length_74 = EvaluateLength(Curve=move_25.Geometry, Length=1, Normalized=True)  # -> Point, Tangent, Parameter; disabled
interpolate_10 = Interpolate(Vertices=evaluate_length_74.Point, Degree=1, Periodic=False, KnotStyle=2)  # -> Curve, Length, Domain; disabled

expression_209 = Expression(O=relative_differences_8, Expression="FORMAT(\"{0:R}\",O)")  # disabled
panel_305 = Panel(expression_209)  # disabled
vector_xyz_14 = VectorXYZ(XComponent=expr("-X", series_23), YComponent=1, ZComponent=0)  # -> Vector, Length; disabled
quick_graph_11 = QuickGraph(relative_differences_8, SortOrder=0)  # disabled
multiplication_18 = Multiplication(A=relative_differences_8, B=digit_scroller_41)  # disabled
line_sdl_28 = LineSDL(Start=divide_curve.Points, Direction=Vector(0, 1, 0), Length=multiplication_18)  # disabled
move_26 = Move(Geometry=line_sdl_28, Motion=vector_xyz_14.Vector)  # -> Geometry, Transform; disabled
evaluate_length_75 = EvaluateLength(Curve=move_26.Geometry, Length=1, Normalized=True)  # -> Point, Tangent, Parameter; disabled
interpolate_11 = Interpolate(Vertices=evaluate_length_75.Point, Degree=1, Periodic=False, KnotStyle=2)  # -> Curve, Length, Domain; disabled

vector_xyz_15 = VectorXYZ(XComponent=expr("-X", series_23), YComponent=2, ZComponent=0)  # -> Vector, Length; disabled
replace_nulls_9 = ReplaceNulls(Items=relative_differences_8, Replacements=0)  # -> Items, Count; disabled
relative_differences_9 = RelativeDifferences(Values=replace_nulls_9.Items)  # disabled
expression_210 = Expression(O=relative_differences_9, Expression="FORMAT(\"{0:R}\",O)")  # disabled
panel_306 = Panel(expression_210)  # disabled
quick_graph_12 = QuickGraph(relative_differences_9, SortOrder=0)  # disabled
multiplication_19 = Multiplication(A=relative_differences_9, B=digit_scroller_38)  # disabled
line_sdl_29 = LineSDL(Start=divide_curve.Points, Direction=Vector(0, 1, 0), Length=multiplication_19)  # disabled
move_27 = Move(Geometry=line_sdl_29, Motion=vector_xyz_15.Vector)  # -> Geometry, Transform; disabled
evaluate_length_76 = EvaluateLength(Curve=move_27.Geometry, Length=1, Normalized=True)  # -> Point, Tangent, Parameter; disabled
interpolate_12 = Interpolate(Vertices=evaluate_length_76.Point, Degree=1, Periodic=False, KnotStyle=2)  # -> Curve, Length, Domain; disabled

vector_xyz_16 = VectorXYZ(XComponent=expr("-X", series_23), YComponent=3, ZComponent=0)  # -> Vector, Length; disabled
replace_nulls_10 = ReplaceNulls(Items=relative_differences_9, Replacements=0)  # -> Items, Count; disabled
relative_differences_10 = RelativeDifferences(Values=replace_nulls_10.Items)  # disabled
expression_211 = Expression(O=relative_differences_10, Expression="FORMAT(\"{0:R}\",O)")  # disabled
panel_307 = Panel(expression_211)  # disabled
quick_graph_13 = QuickGraph(relative_differences_10, SortOrder=0)  # disabled
multiplication_20 = Multiplication(A=relative_differences_10, B=digit_scroller_37)  # disabled
line_sdl_30 = LineSDL(Start=divide_curve.Points, Direction=Vector(0, 1, 0), Length=multiplication_20)  # disabled
move_28 = Move(Geometry=line_sdl_30, Motion=vector_xyz_16.Vector)  # -> Geometry, Transform; disabled
evaluate_length_77 = EvaluateLength(Curve=move_28.Geometry, Length=1, Normalized=True)  # -> Point, Tangent, Parameter; disabled
interpolate_13 = Interpolate(Vertices=evaluate_length_77.Point, Degree=1, Periodic=False, KnotStyle=2)  # -> Curve, Length, Domain; disabled

vector_xyz_17 = VectorXYZ(XComponent=expr("-X", series_23), YComponent=4, ZComponent=0)  # -> Vector, Length; disabled
replace_nulls_11 = ReplaceNulls(Items=relative_differences_10, Replacements=0)  # -> Items, Count; disabled
relative_differences_11 = RelativeDifferences(Values=replace_nulls_11.Items)  # disabled
expression_212 = Expression(O=relative_differences_11, Expression="FORMAT(\"{0:R}\",O)")  # disabled
panel_308 = Panel(expression_212)  # disabled
quick_graph_14 = QuickGraph(relative_differences_11, SortOrder=0)  # disabled
multiplication_21 = Multiplication(A=relative_differences_11, B=digit_scroller_36)  # disabled
line_sdl_31 = LineSDL(Start=divide_curve.Points, Direction=Vector(0, 1, 0), Length=multiplication_21)  # disabled
move_29 = Move(Geometry=line_sdl_31, Motion=vector_xyz_17.Vector)  # -> Geometry, Transform; disabled
evaluate_length_78 = EvaluateLength(Curve=move_29.Geometry, Length=1, Normalized=True)  # -> Point, Tangent, Parameter; disabled
interpolate_14 = Interpolate(Vertices=evaluate_length_78.Point, Degree=1, Periodic=False, KnotStyle=2)  # -> Curve, Length, Domain; disabled

vector_xyz_18 = VectorXYZ(XComponent=expr("-X", series_23), YComponent=5, ZComponent=0)  # -> Vector, Length; disabled
replace_nulls_12 = ReplaceNulls(Items=relative_differences_11, Replacements=0)  # -> Items, Count; disabled
relative_differences_12 = RelativeDifferences(Values=replace_nulls_12.Items)  # disabled
expression_213 = Expression(O=relative_differences_12, Expression="FORMAT(\"{0:R}\",O)")  # disabled
panel_309 = Panel(expression_213)  # disabled
quick_graph_15 = QuickGraph(relative_differences_12, SortOrder=0)  # disabled
multiplication_22 = Multiplication(A=relative_differences_12, B=digit_scroller_42)  # disabled
line_sdl_32 = LineSDL(Start=divide_curve.Points, Direction=Vector(0, 1, 0), Length=multiplication_22)  # disabled
move_30 = Move(Geometry=line_sdl_32, Motion=vector_xyz_18.Vector)  # -> Geometry, Transform; disabled
evaluate_length_79 = EvaluateLength(Curve=move_30.Geometry, Length=1, Normalized=True)  # -> Point, Tangent, Parameter; disabled
interpolate_15 = Interpolate(Vertices=evaluate_length_79.Point, Degree=1, Periodic=False, KnotStyle=2)  # -> Curve, Length, Domain; disabled

replace_nulls_13 = ReplaceNulls(Items=relative_differences_12, Replacements=0)  # -> Items, Count; disabled
relative_differences_13 = RelativeDifferences(Values=replace_nulls_13.Items)  # disabled

expression_214 = Expression(O=relative_differences_13, Expression="FORMAT(\"{0:R}\",O)")  # disabled
panel_310 = Panel(expression_214)  # disabled
vector_xyz_19 = VectorXYZ(XComponent=expr("-X", series_23), YComponent=6, ZComponent=0)  # -> Vector, Length; disabled
quick_graph_16 = QuickGraph(relative_differences_13, SortOrder=0)  # disabled
multiplication_23 = Multiplication(A=relative_differences_13, B=digit_scroller_43)  # disabled
line_sdl_33 = LineSDL(Start=divide_curve.Points, Direction=Vector(0, 1, 0), Length=multiplication_23)  # disabled
move_31 = Move(Geometry=line_sdl_33, Motion=vector_xyz_19.Vector)  # -> Geometry, Transform; disabled
evaluate_length_80 = EvaluateLength(Curve=move_31.Geometry, Length=1, Normalized=True)  # -> Point, Tangent, Parameter; disabled
interpolate_16 = Interpolate(Vertices=evaluate_length_80.Point, Degree=1, Periodic=False, KnotStyle=2)  # -> Curve, Length, Domain; disabled

vector_xyz_20 = VectorXYZ(XComponent=expr("-X", series_23), YComponent=7, ZComponent=0)  # -> Vector, Length; disabled
replace_nulls_14 = ReplaceNulls(Items=relative_differences_13, Replacements=0)  # -> Items, Count; disabled
relative_differences_14 = RelativeDifferences(Values=replace_nulls_14.Items)  # disabled
expression_215 = Expression(O=relative_differences_14, Expression="FORMAT(\"{0:R}\",O)")  # disabled
panel_311 = Panel(expression_215)  # disabled
quick_graph_17 = QuickGraph(relative_differences_14, SortOrder=0)  # disabled
multiplication_24 = Multiplication(A=relative_differences_14, B=digit_scroller_40)  # disabled
line_sdl_34 = LineSDL(Start=divide_curve.Points, Direction=Vector(0, 1, 0), Length=multiplication_24)  # disabled
move_32 = Move(Geometry=line_sdl_34, Motion=vector_xyz_20.Vector)  # -> Geometry, Transform; disabled
evaluate_length_81 = EvaluateLength(Curve=move_32.Geometry, Length=1, Normalized=True)  # -> Point, Tangent, Parameter; disabled
interpolate_17 = Interpolate(Vertices=evaluate_length_81.Point, Degree=1, Periodic=False, KnotStyle=2)  # -> Curve, Length, Domain; disabled

vector_xyz_21 = VectorXYZ(XComponent=expr("-X", series_23), YComponent=8, ZComponent=0)  # -> Vector, Length; disabled
replace_nulls_15 = ReplaceNulls(Items=relative_differences_14, Replacements=0)  # -> Items, Count; disabled
relative_differences_15 = RelativeDifferences(Values=replace_nulls_15.Items)  # disabled
expression_216 = Expression(O=relative_differences_15, Expression="FORMAT(\"{0:R}\",O)")  # disabled
panel_312 = Panel(expression_216)  # disabled
quick_graph_18 = QuickGraph(relative_differences_15, SortOrder=0)  # disabled
multiplication_25 = Multiplication(A=relative_differences_15, B=digit_scroller_44)  # disabled
line_sdl_35 = LineSDL(Start=divide_curve.Points, Direction=Vector(0, 1, 0), Length=multiplication_25)  # disabled
move_33 = Move(Geometry=line_sdl_35, Motion=vector_xyz_21.Vector)  # -> Geometry, Transform; disabled
evaluate_length_82 = EvaluateLength(Curve=move_33.Geometry, Length=1, Normalized=True)  # -> Point, Tangent, Parameter; disabled
interpolate_18 = Interpolate(Vertices=evaluate_length_82.Point, Degree=1, Periodic=False, KnotStyle=2)  # -> Curve, Length, Domain; disabled

custom_preview_18 = CustomPreview(Geometry=interpolate_14.Curve, Material=create_material)  # disabled

custom_preview_19 = CustomPreview(Geometry=move_29.Geometry, Material=create_material_2)  # disabled

custom_preview_20 = CustomPreview(Geometry=interpolate_13.Curve, Material=create_material_3)  # disabled

custom_preview_21 = CustomPreview(Geometry=move_28.Geometry, Material=create_material_4)  # disabled

custom_preview_22 = CustomPreview(Geometry=interpolate_12.Curve, Material=create_material_5)  # disabled

custom_preview_23 = CustomPreview(Geometry=move_27.Geometry, Material=create_material_6)  # disabled

custom_preview_24 = CustomPreview(Geometry=interpolate_11.Curve, Material=create_material_7)  # disabled

custom_preview_25 = CustomPreview(Geometry=move_26.Geometry, Material=create_material_8)  # disabled

custom_preview_26 = CustomPreview(Geometry=interpolate_10.Curve, Material=create_material_9)  # disabled

custom_preview_27 = CustomPreview(Geometry=move_25.Geometry, Material=create_material_10)  # disabled

custom_preview_28 = CustomPreview(Geometry=interpolate_18.Curve, Material=create_material_11)  # disabled

custom_preview_29 = CustomPreview(Geometry=move_33.Geometry, Material=create_material_12)  # disabled

custom_preview_30 = CustomPreview(Geometry=interpolate_17.Curve, Material=create_material_13)  # disabled

custom_preview_31 = CustomPreview(Geometry=move_32.Geometry, Material=create_material_14)  # disabled

custom_preview_32 = CustomPreview(Geometry=interpolate_15.Curve, Material=create_material_15)  # disabled

custom_preview_33 = CustomPreview(Geometry=move_30.Geometry, Material=create_material_16)  # disabled

custom_preview_34 = CustomPreview(Geometry=interpolate_16.Curve, Material=create_material_17)  # disabled

custom_preview_35 = CustomPreview(Geometry=move_31.Geometry, Material=create_material_18)  # disabled

curve_148 = Curve(graft(curve_140))  # disabled
divide_curve_8 = DivideCurve(Curve=curve_148, Count=number_15, Kinks=False)  # -> Points, Tangents, Parameters; disabled
curvature_4 = Curvature(Curve=curve_148, Parameter=divide_curve_8.Parameters)  # -> Point, Curvature, Curvature_2; disabled
deconstruct_arc_4 = DeconstructArc(Arc=curvature_4.Curvature_2)  # -> BasePlane, Radius, Angle; disabled
line_9 = Line(StartPoint=curvature_4.Point, EndPoint=deconstruct_arc_4.BasePlane)  # disabled
one_over_x_4 = OneOverX(Value=deconstruct_arc_4.Radius)  # disabled
quick_graph_19 = QuickGraph(one_over_x_4, SortOrder=0)  # disabled
replace_nulls_16 = ReplaceNulls(Items=one_over_x_4, Replacements=0)  # -> Items, Count; disabled
relative_differences_16 = RelativeDifferences(Values=replace_nulls_16.Items)  # disabled
curvature_graph_2 = CurvatureGraph(Curve=curve_148, Density=1, Scale=digit_scroller_59)  # disabled
custom_preview_36 = CustomPreview(Geometry=curve_148, Material=create_material_21)  # disabled

expression_217 = Expression(O=relative_differences_16, Expression="FORMAT(\"{0:R}\",O)")  # disabled
panel_313 = Panel(expression_217)  # disabled
quick_graph_20 = QuickGraph(relative_differences_16, SortOrder=0)  # disabled

expression_218 = Expression(O=one_over_x_4, Expression="FORMAT(\"{0:R}\",O)")  # disabled
panel_314 = Panel(expression_218)  # disabled

expression_219 = Expression(O=deconstruct_arc_4.Radius, Expression="FORMAT(\"{0:R}\",O)")  # disabled
panel_315 = Panel(expression_219)  # disabled

derivatives = Derivatives(Curve=curve_148, Parameter=divide_curve_8.Parameters)  # -> Point, FirstDerivative, SecondDerivative, ThirdDerivative, FourthDerivative, FifthDerivative, SixthDerivative; disabled
quick_graph_21 = QuickGraph(derivatives.SixthDerivative, SortOrder=0)  # disabled
quick_graph_22 = QuickGraph(derivatives.FifthDerivative, SortOrder=0)  # disabled
quick_graph_23 = QuickGraph(derivatives.FourthDerivative, SortOrder=0)  # disabled
quick_graph_24 = QuickGraph(derivatives.ThirdDerivative, SortOrder=0)  # disabled
quick_graph_25 = QuickGraph(derivatives.SecondDerivative, SortOrder=0)  # disabled
quick_graph_26 = QuickGraph(derivatives.FirstDerivative, SortOrder=0)  # disabled
quick_graph_27 = QuickGraph(derivatives.Point, SortOrder=0)  # disabled
length_2 = Length(Curve=curve_148)  # disabled

relative_differences_17 = RelativeDifferences(Values=relative_differences_16)  # disabled

quick_graph_28 = QuickGraph(relative_differences_17, SortOrder=0)  # disabled
bounds_22 = Bounds(Numbers=relative_differences_17)  # disabled
remap_numbers_9 = RemapNumbers(Value=relative_differences_17, Source=bounds_22, Target=Domain(-1, 1))  # -> Mapped, Clipped; disabled
multiplication_26 = Multiplication(A=remap_numbers_9.Mapped, B=length_2)  # disabled
multiplication_27 = Multiplication(A=multiplication_26, B=digit_scroller_60)  # disabled

relative_differences_18 = RelativeDifferences(Values=relative_differences_17)  # disabled

quick_graph_29 = QuickGraph(relative_differences_18, SortOrder=0)  # disabled

relative_differences_19 = RelativeDifferences(Values=relative_differences_18)  # disabled

quick_graph_30 = QuickGraph(relative_differences_19, SortOrder=0)  # disabled
bounds_23 = Bounds(Numbers=relative_differences_19)  # disabled
remap_numbers_10 = RemapNumbers(Value=relative_differences_19, Source=bounds_23, Target=Domain(-1, 1))  # -> Mapped, Clipped; disabled
multiplication_28 = Multiplication(A=remap_numbers_10.Mapped, B=length_2)  # disabled
multiplication_29 = Multiplication(A=multiplication_28, B=digit_scroller_6)  # disabled

relative_differences_20 = RelativeDifferences(Values=relative_differences_19)  # disabled

relative_differences_21 = RelativeDifferences(Values=relative_differences_20)  # disabled

quick_graph_31 = QuickGraph(relative_differences_21, SortOrder=0)  # disabled
bounds_24 = Bounds(Numbers=relative_differences_21)  # disabled
remap_numbers_11 = RemapNumbers(Value=relative_differences_21, Source=bounds_24, Target=Domain(-1, 1))  # -> Mapped, Clipped; disabled
multiplication_30 = Multiplication(A=remap_numbers_11.Mapped, B=length_2)  # disabled
multiplication_31 = Multiplication(A=multiplication_30, B=digit_scroller_5)  # disabled

relative_differences_22 = RelativeDifferences(Values=relative_differences_21)  # disabled

quick_graph_32 = QuickGraph(relative_differences_22, SortOrder=0)  # disabled
bounds_25 = Bounds(Numbers=relative_differences_22)  # disabled
remap_numbers_12 = RemapNumbers(Value=relative_differences_22, Source=bounds_25, Target=Domain(-1, 1))  # -> Mapped, Clipped; disabled
multiplication_32 = Multiplication(A=remap_numbers_12.Mapped, B=length_2)  # disabled
multiplication_33 = Multiplication(A=multiplication_32, B=digit_scroller_55)  # disabled

relative_differences_23 = RelativeDifferences(Values=relative_differences_22)  # disabled

quick_graph_33 = QuickGraph(relative_differences_23, SortOrder=0)  # disabled
bounds_26 = Bounds(Numbers=relative_differences_23)  # disabled
remap_numbers_13 = RemapNumbers(Value=relative_differences_23, Source=bounds_26, Target=Domain(-1, 1))  # -> Mapped, Clipped; disabled
multiplication_34 = Multiplication(A=remap_numbers_13.Mapped, B=length_2)  # disabled
multiplication_35 = Multiplication(A=multiplication_34, B=digit_scroller_4)  # disabled

quick_graph_34 = QuickGraph(relative_differences_20, SortOrder=0)  # disabled
bounds_27 = Bounds(Numbers=relative_differences_20)  # disabled
remap_numbers_14 = RemapNumbers(Value=relative_differences_20, Source=bounds_27, Target=Domain(-1, 1))  # -> Mapped, Clipped; disabled
multiplication_36 = Multiplication(A=remap_numbers_14.Mapped, B=length_2)  # disabled
multiplication_37 = Multiplication(A=multiplication_36, B=digit_scroller_7)  # disabled

bounds_28 = Bounds(Numbers=relative_differences_18)  # disabled
remap_numbers_15 = RemapNumbers(Value=relative_differences_18, Source=bounds_28, Target=Domain(-1, 1))  # -> Mapped, Clipped; disabled

bounds_29 = Bounds(Numbers=relative_differences_16)  # disabled
remap_numbers_16 = RemapNumbers(Value=relative_differences_16, Source=bounds_29, Target=Domain(-1, 1))  # -> Mapped, Clipped; disabled

bounds_30 = Bounds(Numbers=one_over_x_4)  # disabled
remap_numbers_17 = RemapNumbers(Value=one_over_x_4, Source=bounds_30, Target=Domain(0, 1))  # -> Mapped, Clipped; disabled

multiplication_38 = Multiplication(A=remap_numbers_15.Mapped, B=length_2)  # disabled

multiplication_39 = Multiplication(A=multiplication_38, B=digit_scroller_57)  # disabled

multiplication_40 = Multiplication(A=remap_numbers_16.Mapped, B=length_2)  # disabled
multiplication_41 = Multiplication(A=length_2, B=remap_numbers_17.Mapped)  # disabled

multiplication_42 = Multiplication(A=multiplication_40, B=digit_scroller_61)  # disabled

multiplication_43 = Multiplication(A=multiplication_41, B=digit_scroller_56)  # disabled

line_sdl_36 = LineSDL(Start=curvature_4.Point, Direction=line_9, Length=expr("-X", multiplication_43))  # disabled
evaluate_length_83 = EvaluateLength(Curve=line_sdl_36, Length=1, Normalized=True)  # -> Point, Tangent, Parameter; disabled
interpolate_19 = Interpolate(Vertices=evaluate_length_83.Point, Degree=1, Periodic=False, KnotStyle=2)  # -> Curve, Length, Domain; disabled
custom_preview_37 = CustomPreview(Geometry=line_sdl_36, Material=create_material_20)  # disabled
curve_149 = Curve(interpolate_19.Curve)  # disabled
custom_preview_38 = CustomPreview(Geometry=curve_149, Material=create_material_19)  # disabled

line_sdl_37 = LineSDL(Start=evaluate_length_83.Point, Direction=line_sdl_36, Length=expr("ABS(X)", multiplication_42))  # disabled
nurbs_curve = NurbsCurve(Vertices=evaluate_length_83.Point, Degree=3, Periodic=False)  # -> Curve, Length, Domain; disabled
custom_preview_39 = CustomPreview(Geometry=line_sdl_37, Material=create_material_25)  # disabled
curve_150 = Curve(line_sdl_37)  # disabled
evaluate_length_84 = EvaluateLength(Curve=curve_150, Length=1, Normalized=True)  # -> Point, Tangent, Parameter; disabled
line_sdl_38 = LineSDL(Start=evaluate_length_84.Point, Direction=derivatives.ThirdDerivative, Length=expr("-X", multiplication_42))  # disabled
evaluate_length_85 = EvaluateLength(Curve=line_sdl_38, Length=1, Normalized=True)  # -> Point, Tangent, Parameter; disabled
interpolate_20 = Interpolate(Vertices=evaluate_length_85.Point, Degree=3, Periodic=False, KnotStyle=2)  # -> Curve, Length, Domain; disabled
custom_preview_40 = CustomPreview(Geometry=interpolate_20.Curve, Material=create_material_22)  # disabled
custom_preview_41 = CustomPreview(Geometry=line_sdl_38, Material=create_material_23)  # disabled
interpolate_21 = Interpolate(Vertices=evaluate_length_84.Point, Degree=1, Periodic=False, KnotStyle=2)  # -> Curve, Length, Domain; disabled
polyline = PolyLine(Vertices=evaluate_length_84.Point, Closed=False)  # disabled
explode_8 = Explode(Curve=polyline, Recursive=True)  # -> Segments, Vertices; disabled
custom_preview_42 = CustomPreview(Geometry=interpolate_21.Curve, Material=create_material_24)  # disabled
curve_151 = Curve(flatten(explode_8.Segments))  # disabled
length_3 = Length(Curve=curve_151)  # disabled
sort_list = SortList(Keys=length_3, ValuesValuesA=curve_151)  # -> Keys, ValuesValuesA; disabled
list_item_9 = ListItem(List=sort_list.Keys, Index=0, Wrap=False)  # disabled
dot_display = DotDisplay(Point=evaluate_length_84.Point, Colour=RGB(194, 194, 194), Size=expr("X/2", list_item_9))  # disabled

expression_220 = Expression(O=sort_list.Keys, Expression="FORMAT(\"{0:R}\",O)")  # disabled
panel_316 = Panel(expression_220)  # disabled

line_sdl_39 = LineSDL(Start=evaluate_length_84.Point, Direction=line_sdl_36, Length=expr("ABS(X)", multiplication_27))  # disabled

evaluate_length_86 = EvaluateLength(Curve=line_sdl_39, Length=1, Normalized=True)  # -> Point, Tangent, Parameter; disabled
interpolate_22 = Interpolate(Vertices=evaluate_length_86.Point, Degree=1, Periodic=False, KnotStyle=2)  # -> Curve, Length, Domain; disabled
custom_preview_43 = CustomPreview(Geometry=interpolate_22.Curve, Material=create_material_38)  # disabled
custom_preview_44 = CustomPreview(Geometry=line_sdl_39, Material=create_material_39)  # disabled

line_sdl_40 = LineSDL(Start=evaluate_length_86.Point, Direction=line_sdl_36, Length=expr("ABS(X)", multiplication_39))  # disabled

evaluate_length_87 = EvaluateLength(Curve=line_sdl_40, Length=1, Normalized=True)  # -> Point, Tangent, Parameter; disabled
interpolate_23 = Interpolate(Vertices=evaluate_length_87.Point, Degree=1, Periodic=False, KnotStyle=2)  # -> Curve, Length, Domain; disabled
custom_preview_45 = CustomPreview(Geometry=interpolate_23.Curve, Material=create_material_36)  # disabled
custom_preview_46 = CustomPreview(Geometry=line_sdl_40, Material=create_material_37)  # disabled

line_sdl_41 = LineSDL(Start=evaluate_length_87.Point, Direction=line_sdl_36, Length=expr("ABS(X)", multiplication_29))  # disabled

evaluate_length_88 = EvaluateLength(Curve=line_sdl_41, Length=1, Normalized=True)  # -> Point, Tangent, Parameter; disabled
interpolate_24 = Interpolate(Vertices=evaluate_length_88.Point, Degree=1, Periodic=False, KnotStyle=2)  # -> Curve, Length, Domain; disabled
custom_preview_47 = CustomPreview(Geometry=interpolate_24.Curve, Material=create_material_34)  # disabled
custom_preview_48 = CustomPreview(Geometry=line_sdl_41, Material=create_material_35)  # disabled

line_sdl_42 = LineSDL(Start=evaluate_length_88.Point, Direction=line_sdl_36, Length=expr("ABS(X)", multiplication_37))  # disabled

evaluate_length_89 = EvaluateLength(Curve=line_sdl_42, Length=1, Normalized=True)  # -> Point, Tangent, Parameter; disabled
interpolate_25 = Interpolate(Vertices=evaluate_length_89.Point, Degree=1, Periodic=False, KnotStyle=2)  # -> Curve, Length, Domain; disabled
custom_preview_49 = CustomPreview(Geometry=interpolate_25.Curve, Material=create_material_32)  # disabled
custom_preview_50 = CustomPreview(Geometry=line_sdl_42, Material=create_material_33)  # disabled

line_sdl_43 = LineSDL(Start=evaluate_length_89.Point, Direction=line_sdl_36, Length=expr("ABS(X)", multiplication_31))  # disabled

evaluate_length_90 = EvaluateLength(Curve=line_sdl_43, Length=1, Normalized=True)  # -> Point, Tangent, Parameter; disabled
interpolate_26 = Interpolate(Vertices=evaluate_length_90.Point, Degree=1, Periodic=False, KnotStyle=2)  # -> Curve, Length, Domain; disabled
custom_preview_51 = CustomPreview(Geometry=interpolate_26.Curve, Material=create_material_30)  # disabled
custom_preview_52 = CustomPreview(Geometry=line_sdl_43, Material=create_material_31)  # disabled

line_sdl_44 = LineSDL(Start=evaluate_length_90.Point, Direction=line_sdl_36, Length=expr("ABS(X)", multiplication_33))  # disabled

evaluate_length_91 = EvaluateLength(Curve=line_sdl_44, Length=1, Normalized=True)  # -> Point, Tangent, Parameter; disabled
interpolate_27 = Interpolate(Vertices=evaluate_length_91.Point, Degree=1, Periodic=False, KnotStyle=2)  # -> Curve, Length, Domain; disabled
custom_preview_53 = CustomPreview(Geometry=interpolate_27.Curve, Material=create_material_28)  # disabled
custom_preview_54 = CustomPreview(Geometry=line_sdl_44, Material=create_material_29)  # disabled

line_sdl_45 = LineSDL(Start=evaluate_length_91.Point, Direction=line_sdl_36, Length=expr("ABS(X)", multiplication_35))  # disabled

evaluate_length_92 = EvaluateLength(Curve=line_sdl_45, Length=1, Normalized=True)  # -> Point, Tangent, Parameter; disabled
interpolate_28 = Interpolate(Vertices=evaluate_length_92.Point, Degree=1, Periodic=False, KnotStyle=2)  # -> Curve, Length, Domain; disabled
custom_preview_55 = CustomPreview(Geometry=interpolate_28.Curve, Material=create_material_26)  # disabled
custom_preview_56 = CustomPreview(Geometry=line_sdl_45, Material=create_material_27)  # disabled

curve_152 = Curve(interpolate_22.Curve)  # disabled
curve_153 = Curve(interpolate_21.Curve)  # disabled
evaluate_length_93 = EvaluateLength(Curve=curve_153, Length=[0.0625, 0.1875, 0.3125, 0.4375, 0.5625, 0.6875, 0.8125, 0.9375], Normalized=True)  # -> Point, Tangent, Parameter; disabled
circle_tantan = CircleTanTan(CurveA=curve_153, CurveB=curve_152, Point=evaluate_length_93.Point)  # disabled

curve_154 = Curve(interpolate_21.Curve)  # disabled
curve_155 = Curve(interpolate_19.Curve)  # disabled
evaluate_length_94 = EvaluateLength(Curve=curve_155, Length=[0.125, 0.375, 0.625, 0.875], Normalized=True)  # -> Point, Tangent, Parameter; disabled
circle_tantan_2 = CircleTanTan(CurveA=curve_155, CurveB=curve_154, Point=evaluate_length_94.Point)  # disabled

length_4 = Length(Curve=line_sdl_36)  # disabled
sort_list_2 = SortList(Keys=length_4, ValuesValuesA=line_sdl_36)  # -> reverse(flatten(Keys)), reverse(flatten(ValuesValuesA)); disabled
list_item_10 = ListItem(List=sort_list_2.Keys, Index=0, Wrap=False)  # disabled
panel_317 = Panel(list_item_10)  # disabled

length_5 = Length(Curve=line_sdl_39)  # disabled
sort_list_3 = SortList(Keys=length_5, ValuesValuesA=line_sdl_39)  # -> reverse(flatten(Keys)), reverse(flatten(ValuesValuesA)); disabled
list_item_11 = ListItem(List=sort_list_3.Keys, Index=0, Wrap=False)  # disabled
panel_318 = Panel(list_item_11)  # disabled
division_29 = Division(A=list_item_10, B=list_item_11)  # disabled
expression_221 = Expression(X=division_29, Expression="FORMAT(\"{0:R}\",X)")  # -> simplify(Result); disabled
panel_319 = Panel(expression_221)  # disabled

curve_156 = Curve(curve_148)  # disabled
curve_157 = Curve(interpolate_19.Curve)  # disabled
evaluate_length_95 = EvaluateLength(Curve=curve_157, Length=[0.25, 0.75], Normalized=True)  # -> Point, Tangent, Parameter; disabled
circle_tantan_3 = CircleTanTan(CurveA=curve_157, CurveB=curve_156, Point=evaluate_length_95.Point)  # disabled
