# Grasshopper definition XHG....ⵙ⠀ᗝ⠀ⵙ⠀ꖴ⠀ⵙ⠀Ⓞ⠀ⵙ⠀ᙏ⠀ⵙ⠀ᕤᕦ⠀ⵙ⠀ꖴ⠀ⵙ⠀ᔓᔕ⠀ⵙ⠀◯⠀ⵙ⠀ИN⠀ⵙ⠀Ⓞ⠀ⵙ⠀ꖴ⠀ⵙ⠀✤⠀ⵙ⠀ꖴ⠀ⵙ⠀ᔓᔕ⠀ⵙ⠀ИN⠀ⵙ⠀ᗩ⠀ⵙ⠀ᴥ⠀ⵙ⠀✤⠀ⵙ⠀◯⠀ⵙ⠀ᗱᗴ⠀ⵙ⠀ᕤᕦ⠀ⵙ⠀ᗝ⠀ⵙ⠀ᗱᗴ⠀ⵙ⠀◯⠀ⵙ⠀ᙁ⠀ⵙ⠀ᑎ⠀ⵙ⠀ꗳ⠀ⵙ⠀◯⠀ⵙ⠀◯⠀ⵙ⠀ꗳ⠀ⵙ⠀ᑎ⠀ⵙ⠀ᙁ⠀ⵙ⠀◯⠀ⵙ⠀ᗱᗴ⠀ⵙ⠀ᗝ⠀ⵙ⠀ᕤᕦ⠀ⵙ⠀ᗱᗴ⠀ⵙ⠀◯⠀ⵙ⠀✤⠀ⵙ⠀ᴥ⠀ⵙ⠀ᗩ⠀ⵙ⠀ИN⠀ⵙ⠀ᔓᔕ⠀ⵙ⠀ꖴ⠀ⵙ⠀✤⠀ⵙ⠀ꖴ⠀ⵙ⠀Ⓞ⠀ⵙ⠀ИN⠀ⵙ⠀◯⠀ⵙ⠀ᔓᔕ⠀ⵙ⠀ꖴ⠀ⵙ⠀ᕤᕦ⠀ⵙ⠀ᙏ⠀ⵙ⠀Ⓞ⠀ⵙ⠀ꖴ⠀ⵙ⠀ᗝ⠀ⵙ....GHX (Grasshopper 1.0.7)
# plug-ins: Pufferfish, Heteroptera

digit_scroller = DigitScroller(Scroller_Digits=12, Scroller_Prefix=" ", Scroller_Radix=1, Scroller_Value=0.5)
line_sdl = LineSDL(Start=Point(0, 0, 0), Direction=Vector(-0.5, 0, 0), Length=1)
line_sdl_2 = LineSDL(Start=Point(1, 1, 0), Direction=Vector(1, 0, 0), Length=1)
flip_curve = FlipCurve(Curve=line_sdl)  # -> Curve, Flag
blend_curve = BlendCurve(CurveA=flip_curve.Curve, CurveB=line_sdl_2, BulgeA=digit_scroller, BulgeB=digit_scroller, Continuity=2)
flip_curve_2 = FlipCurve(Curve=line_sdl_2)  # -> Curve, Flag

point = Point(Point(0.5, 0.5, 0))  # disabled
xy_plane = XYPlane(Origin=point)  # disabled
point_2 = Point(Point(0, 0, 0))  # disabled
point_3 = Point(Point(0.25, 0, 0))  # disabled
point_4 = Point(Point(0.3947752686, 0.1978476179, 0))  # disabled
merge = Merge(Data1=point_2, Data2=point_3, Data3=point_4)  # disabled
rotate = Rotate(Geometry=merge, Angle=3.141592654, Plane=point)  # -> reverse(Geometry), Transform; disabled
mirror = Mirror(Geometry=rotate.Geometry, Plane=xy_plane)  # -> Geometry, Transform; disabled
merge_2 = Merge(Data1=merge, Data2=point, Data3=mirror.Geometry)  # disabled
nurbs_curve = NurbsCurve(Vertices=merge_2, Degree=11, Periodic=False)  # -> Curve, Length, Domain; disabled
interpolate = Interpolate(Vertices=merge_2, Degree=3, Periodic=False, KnotStyle=1)  # -> Curve, Length, Domain; disabled
point_5 = Point(Point(0.2006577215, 0, 0))  # disabled
point_6 = Point(Point(0.2830260225, 0.08609833668, 0))  # disabled
point_7 = Point(Point(0.3323482284, 0.16322326, 0))  # disabled

curve = Curve(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)

digit_scroller_2 = DigitScroller(Scroller_Digits=12, Scroller_Prefix=" ", Scroller_Radix=1, Scroller_Value=0.01794871794)

curve_2 = Curve(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)
panel = Panel("0.00137956207")
curve_3 = Curve(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)
curve_4 = Curve(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)

number_slider = Slider(13.114764, range=0..256)  # disabled
line_sdl_3 = LineSDL(Start=Point(0, 0, 0), Direction=Vector(1, 0, 0), Length=1)  # disabled

number = Number(1024)  # disabled

divide_curve = DivideCurve(Curve=line_sdl_3, Count=number, Kinks=False)  # -> Points, Tangents, Parameters; disabled

digit_scroller_3 = DigitScroller(Scroller_Digits=12, Scroller_Prefix=" ", Scroller_Radix=11, Scroller_Value=256)  # disabled
digit_scroller_4 = DigitScroller(Scroller_Digits=12, Scroller_Prefix=" ", Scroller_Radix=11, Scroller_Value=90)  # disabled
create_material = CreateMaterial(Diffuse=RGB(222, 222, 222), Specular=RGB(0, 255, 255), Emission=RGB(0, 0, 0), Transparency=0.5, Shine=100)  # disabled
create_material_2 = CreateMaterial(Diffuse=RGB(247, 247, 247), Specular=RGB(0, 255, 255), Emission=RGB(0, 0, 0), Transparency=0.5, Shine=100)  # disabled
create_material_3 = CreateMaterial(Diffuse=RGB(176, 176, 176), Specular=RGB(0, 255, 255), Emission=RGB(0, 0, 0), Transparency=0.5, Shine=100)  # disabled
number_2 = Number(digit_scroller_3)  # disabled
number_3 = Number(number_2)  # disabled

number_slider_2 = Slider(0.452284, range=0..1)  # disabled

number_slider_3 = Slider(0.0625, range=0..2)  # disabled

create_material_4 = CreateMaterial(Diffuse=RGB(207, 207, 207), Specular=RGB(0, 255, 255), Emission=RGB(0, 0, 0), Transparency=0.5, Shine=100)  # disabled
create_material_5 = CreateMaterial(Diffuse=RGB(232, 232, 232), Specular=RGB(0, 255, 255), Emission=RGB(0, 0, 0), Transparency=0.5, Shine=100)  # disabled
create_material_6 = CreateMaterial(Diffuse=RGB(214, 214, 214), Specular=RGB(0, 255, 255), Emission=RGB(0, 0, 0), Transparency=0.5, Shine=100)  # disabled
create_material_7 = CreateMaterial(Diffuse=RGB(240, 240, 240), Specular=RGB(0, 255, 255), Emission=RGB(0, 0, 0), Transparency=0.5, Shine=100)  # disabled

digit_scroller_5 = DigitScroller(Scroller_Digits=12, Scroller_Prefix="Digit Scroller", Scroller_Radix=11, Scroller_Value=65536)  # disabled
construct_point = ConstructPoint(XCoordinate=0.5, YCoordinate=0.5, ZCoordinate=0)  # -> flatten(Point); disabled
line_sdl_4 = LineSDL(Start=Point(0, 0, 0), Direction=Vector(1, 0, 0), Length=expr("X/2", 1))  # disabled
button = Button()  # disabled
file_path = FilePath("C:\IICSA.O____48361_EDIWID_1_TNEMERCNI____TNEIDARG_PUKOOL_ROLOC_DIOMGIS_ERUTAWRUC_RAENIL_NOITISNART_EGDE_LUF_EKUN____O____NUKE_FUL_EDGE_TRANSITION_LINEAR_CURWATURE_SIGMOID_COLOR_LOOKUP_GRADIENT____INCREMENT_1_DIWIDE_16384____O.ASCII")  # disabled
number_4 = Number(digit_scroller_5)  # disabled

button_2 = Button()  # disabled
file_path_2 = FilePath("C:\VSC.O____STNEMGES_48361____DIOMGIS_ERUTAWRUC_RAENIL_NOITISNART_EGDE_LUF____O____FUL_EDGE_TRANSITION_LINEAR_CURWATURE_SIGMOID____16384_SEGMENTS____O.CSV")  # disabled

number_slider_4 = Slider(0, range=0..1)  # disabled
button_3 = Button()  # disabled
file_path_3 = FilePath("C:\VSC.O____EPAHS_LANGIS____STNEMGES_48361____DIOMGIS_ERUTAWRUC_RAENIL_NOITISNART_EGDE_LUF____O____FUL_EDGE_TRANSITION_LINEAR_CURWATURE_SIGMOID____16384_SEGMENTS____SIGNAL_SHAPE____O.CSV")  # disabled

panel_2 = Panel("0.0000053644183496292")  # disabled
panel_3 = Panel("""0    256    0.0013733120705119695
0    4096    0.0000053644183496292""")  # disabled

digit_scroller_6 = DigitScroller(Scroller_Digits=12, Scroller_Prefix="Digit Scroller", Scroller_Radix=1, Scroller_Value=3.3527e-07)  # disabled
number_slider_5 = Slider(4096, range=0..65536)  # disabled
radians = Radians(Degrees=panel_2)  # disabled

number_5 = Number(number_slider_5)  # disabled

series = Series(Start=0, Step=radians, Count=number_5)  # disabled
one_over_x = OneOverX(Value=number_5)  # disabled
duplicate_data = DuplicateData(Data=one_over_x, Number=number_5, Order=True)  # disabled
turtle = DotNETVBScriptLEGACY(Forward=duplicate_data, Left=series)  # -> Output, Points; inputs Forward: list, Left: list; disabled
# ---------- turtle: VB ----------
    Dim i As Integer
    Dim dir As New On3dVector(1, 0, 0)    
    Dim pos As New On3dVector(0, 0, 0) 
    Dim axis As New On3dVector(0, 0, 1)
    Dim pnts As New List(Of On3dVector)

    pnts.Add(pos)
    
    For i = 0 To Forward.Count() - 1
      Dim P As New On3dVector
      dir.Rotate(Left(i), axis)      
      P = dir * Forward(i) + pnts(i)
      pnts.Add(P)
    Next
    
    Points = pnts
# ---------- end turtle ----------
point_8 = Point(turtle.Points)  # disabled

interpolate_t = InterpolateT(Vertices=point_8, TangentStart=Vector(0.0625, 0, 0), TangentEnd=Vector(0, 0, 0), KnotStyle=2)  # -> Curve, Length, Domain; disabled
evaluate_length = EvaluateLength(Curve=interpolate_t.Curve, Length=1, Normalized=True)  # -> Point, Tangent, Parameter; disabled
line_sdl_5 = LineSDL(Start=evaluate_length.Point, Direction=evaluate_length.Tangent, Length=1)  # disabled
mirror_2 = Mirror(Geometry=interpolate_t.Curve, Plane=line_sdl_5)  # -> Geometry, Transform; disabled
join_curves = JoinCurves(Curves=[interpolate_t.Curve, mirror_2.Geometry], Preserve=False)  # disabled
evaluate_length_2 = EvaluateLength(Curve=join_curves, Length=1, Normalized=True)  # -> Point, Tangent, Parameter; disabled
rotate_2 = Rotate(Geometry=join_curves, Angle=3.141592654, Plane=evaluate_length_2.Point)  # -> Geometry, Transform; disabled
join_curves_2 = JoinCurves(Curves=[join_curves, rotate_2.Geometry], Preserve=False)  # disabled
curve_5 = Curve(join_curves_2)  # disabled

expression = Expression(O=turtle.Points, Expression="FORMAT(\"{0:R}\",O)")  # disabled
panel_4 = Panel(expression)  # disabled
expression_2 = Expression(O=series, Expression="FORMAT(\"{0:R}\",O)")  # disabled
panel_5 = Panel(expression_2)  # disabled
evaluate_length_3 = EvaluateLength(Curve=join_curves_2, Length=1, Normalized=True)  # -> Point, Tangent, Parameter; disabled
deconstruct = Deconstruct(Point=evaluate_length_3.Point)  # -> XComponent, YComponent, ZComponent; disabled
expression_3 = Expression(O=deconstruct.YComponent, Expression="FORMAT(\"{0:R}\",O)")  # disabled
expression_4 = Expression(O=deconstruct.XComponent, Expression="FORMAT(\"{0:R}\",O)")  # disabled
expression_5 = Expression(O=deconstruct.ZComponent, Expression="FORMAT(\"{0:R}\",O)")  # disabled
panel_6 = Panel(expression_3)  # disabled
panel_7 = Panel(expression_4)  # disabled
panel_8 = Panel(expression_5)  # disabled
addition = Addition(A=panel_6, B=panel_7)  # disabled
expression_6 = Expression(O=addition, Expression="FORMAT(\"{0:R}\",O)")  # disabled
panel_9 = Panel(expression_6)  # disabled
division = Division(A=panel_9, B=2)  # disabled
expression_7 = Expression(O=division, Expression="FORMAT(\"{0:R}\",O)")  # disabled
panel_10 = Panel(expression_7)  # disabled
scale = Scale(Geometry=curve_5, Center=Point(0, 0, 0), Factor=expr("1/X", panel_10))  # -> Geometry, Transform; disabled
evaluate_length_4 = EvaluateLength(Curve=scale.Geometry, Length=1, Normalized=True)  # -> Point, Tangent, Parameter; disabled
deconstruct_2 = Deconstruct(Point=evaluate_length_4.Point)  # -> XComponent, YComponent, ZComponent; disabled
expression_8 = Expression(O=deconstruct_2.YComponent, Expression="FORMAT(\"{0:R}\",O)")  # disabled
expression_9 = Expression(O=deconstruct_2.XComponent, Expression="FORMAT(\"{0:R}\",O)")  # disabled
expression_10 = Expression(O=deconstruct_2.ZComponent, Expression="FORMAT(\"{0:R}\",O)")  # disabled
panel_11 = Panel(expression_8)  # disabled
panel_12 = Panel(expression_9)  # disabled
panel_13 = Panel(expression_10)  # disabled
division_2 = Division(A=panel_7, B=panel_6)  # disabled
expression_11 = Expression(O=division_2, Expression="FORMAT(\"{0:R}\",O)")  # disabled
panel_14 = Panel(expression_11)  # disabled
curve_6 = Curve(scale.Geometry)  # disabled

number_6 = Number(expr("X*4", number_5))  # disabled
divide_curve_2 = DivideCurve(Curve=line_sdl_4, Count=expr("X/2", number_6), Kinks=False)  # -> Points, Tangents, Parameters; disabled
line_sdl_6 = LineSDL(Start=divide_curve_2.Points, Direction=Vector(0, 1, 0), Length=1)  # disabled
scale_2 = Scale(Geometry=line_sdl_6, Center=Point(0, 0, 0), Factor=number_4)  # -> Geometry, Transform; disabled
curve_7 = Curve(curve_6)  # disabled
scale_3 = Scale(Geometry=curve_7, Center=Point(0, 0, 0), Factor=number_4)  # -> Geometry, Transform; disabled
curve_curve = CurveCurve(CurveA=scale_3.Geometry, CurveB=scale_2.Geometry)  # -> flatten(Points), ParamsA, ParamsB; disabled
scale_4 = Scale(Geometry=curve_curve.Points, Center=Point(0, 0, 0), Factor=expr("1/X", number_4))  # -> Geometry, Transform; disabled
deconstruct_3 = Deconstruct(Point=scale_4.Geometry)  # -> expr("ABS(X)", graft(XComponent)), expr("ABS(X)", graft(YComponent)), expr("ABS(X)", graft(ZComponent)); disabled
construct_point_2 = ConstructPoint(XCoordinate=deconstruct_3.XComponent, YCoordinate=deconstruct_3.YComponent, ZCoordinate=deconstruct_3.ZComponent)  # disabled
list_length = ListLength(List=scale_4.Geometry)  # disabled
panel_16 = Panel(list_length)  # disabled
construct_domain = ConstructDomain(DomainStart=0, DomainEnd=expr("X-2", panel_16))  # disabled
range = Range(Domain=construct_domain, Steps=expr("X-2", panel_16))  # disabled
list_item = ListItem(List=flatten(construct_point_2), Index=range, Wrap=False)  # -> flatten(Item); disabled
rotate_3 = Rotate(Geometry=list_item, Angle=3.141592654, Plane=construct_point)  # -> reverse(flatten(Geometry)), Transform; disabled
merge_3 = Merge(Data1=list_item, Data2=construct_point, Data3=rotate_3.Geometry)  # disabled
deconstruct_4 = Deconstruct(Point=merge_3)  # -> graft(XComponent), graft(YComponent), ZComponent; disabled
expression_12 = Expression(O=deconstruct_4.XComponent, Expression="FORMAT(\"{0:0.00000000000000}\",O)")  # disabled
expression_13 = Expression(O=deconstruct_4.XComponent, Expression="FORMAT(\"{0:R}\",O)")  # disabled
data = Data(expression_13)  # disabled
panel_17 = Panel(data)  # disabled
expression_14 = Expression(O=deconstruct_4.YComponent, Expression="FORMAT(\"{0:0.00000000000000}\",O)")  # disabled
expression_15 = Expression(O=deconstruct_4.YComponent, Expression="FORMAT(\"{0:R}\",O)")  # disabled
data_2 = Data(expression_15)  # disabled
panel_18 = Panel(data_2)  # disabled
txtwriter = VBScript(filePath=file_path, data=flatten(panel_18), activate=button)  # -> out, A; inputs data: list; disabled
# ---------- txtwriter: VB ----------
    If activate Then

      Dim i As Integer
      Dim aryText(4) As String

      aryText(0) = "Mary WriteLine"
      aryText(1) = "Had"
      aryText(2) = "Another"
      aryText(3) = "Little"
      aryText(4) = "One"

      ' the data is appended to the file. If file doesnt exist, a new file is created
      Dim objWriter As New System.IO.StreamWriter(filePath, append)

      For i = 0 To data.Count - 1
        objWriter.WriteLine(data(i))
      Next

      objWriter.Close()

    End If

    If clearFile Then
      Dim objWriter As New System.IO.StreamWriter(filePath, False)
      objWriter.Close()
    End If
# ---------- end txtwriter ----------

number_7 = Number(expr("X*4", number_5))  # disabled
curve_8 = Curve(curve_6)  # disabled
divide_curve_3 = DivideCurve(Curve=curve_8, Count=number_7, Kinks=False)  # -> Points, Tangents, Parameters; disabled
deconstruct_5 = Deconstruct(Point=divide_curve_3.Points)  # -> graft(XComponent), graft(YComponent), ZComponent; disabled
expression_16 = Expression(Y=deconstruct_5.YComponent, Expression="FORMAT(\"{0:R}\",ROUND(Y, 15))")  # -> simplify(Result); disabled
expression_17 = Expression(X=deconstruct_5.XComponent, Expression="FORMAT(\"{0:R}\",ROUND(X, 15))")  # -> simplify(Result); disabled
expression_18 = Expression(X=deconstruct_5.XComponent, Expression="FORMAT(\"{0:R}\",X)")  # -> simplify(Result); disabled
panel_19 = Panel(expression_18)  # disabled
expression_19 = Expression(Y=deconstruct_5.YComponent, Expression="FORMAT(\"{0:R}\",Y)")  # -> simplify(Result); disabled
list_length_2 = ListLength(List=divide_curve_3.Points)  # disabled
duplicate_data_2 = DuplicateData(Data=";", Number=list_length_2, Order=True)  # -> simplify(graft(Data)); disabled
panel_20 = Panel(duplicate_data_2)  # disabled
panel_21 = Panel(expression_19)  # disabled
concatenate = Concatenate(FragmentA=panel_19, FragmentB=panel_20, FragmentA_2=panel_21)  # -> flatten(Result); disabled
panel_22 = Panel(concatenate)  # disabled
txtwriter_2 = VBScript(filePath=file_path_2, data=flatten(panel_22), activate=button_2)  # -> out, A; inputs data: list; disabled; same code as txtwriter

number_8 = Number(expr("X*4", number_5))  # disabled
curve_9 = Curve(curve_6)  # disabled
evaluate_length_5 = EvaluateLength(Curve=curve_9, Length=flatten(1), Normalized=True)  # -> Point, Tangent, Parameter; disabled
yz_plane = YZPlane(Origin=evaluate_length_5.Point)  # disabled
mirror_3 = Mirror(Geometry=curve_9, Plane=yz_plane)  # -> Geometry, Transform; disabled
join_curves_3 = JoinCurves(Curves=[curve_9, mirror_3.Geometry], Preserve=False)  # disabled
linear_array = LinearArray(Geometry=join_curves_3, Direction=Vector(2, 0, 0), Count=2)  # -> Geometry, Transform; disabled
join_curves_4 = JoinCurves(Curves=linear_array.Geometry, Preserve=False)  # disabled
flip_curve_3 = FlipCurve(Curve=join_curves_4)  # -> Curve, Flag; disabled
stream_filter = StreamFilter(Gate=number_slider_4, Stream0=join_curves_4, Stream1=flip_curve_3.Curve)  # disabled
curve_domain = CurveDomain(Curve=stream_filter)  # -> Curve, Domain; disabled
deconstruct_domain = DeconstructDomain(Domain=curve_domain.Domain)  # -> Start, End; disabled
construct_domain_2 = ConstructDomain(DomainStart=expr("X/8", deconstruct_domain.End), DomainEnd=expr("X*5/8", deconstruct_domain.End))  # disabled
sub_curve = SubCurve(BaseCurve=curve_domain.Curve, Domain=construct_domain_2)  # disabled
move = Move(Geometry=sub_curve, Motion=Vector(-0.5, -0.5, 0))  # -> Geometry, Transform; disabled
scale_5 = Scale(Geometry=move.Geometry, Center=Point(0, 0, 0), Factor=0.5)  # -> Geometry, Transform; disabled
divide_curve_4 = DivideCurve(Curve=scale_5.Geometry, Count=number_8, Kinks=False)  # -> Points, Tangents, Parameters; disabled
deconstruct_6 = Deconstruct(Point=divide_curve_4.Points)  # -> simplify(graft(XComponent)), simplify(graft(YComponent)), ZComponent; disabled
expression_20 = Expression(X=deconstruct_6.XComponent, Expression="FORMAT(\"{0:R}\",X)")  # disabled
panel_23 = Panel(expression_20)  # disabled
expression_21 = Expression(Y=deconstruct_6.YComponent, Expression="FORMAT(\"{0:R}\",Y)")  # disabled
list_length_3 = ListLength(List=divide_curve_4.Points)  # disabled
duplicate_data_3 = DuplicateData(Data=";", Number=list_length_3, Order=True)  # -> simplify(graft(Data)); disabled
panel_24 = Panel(duplicate_data_3)  # disabled
panel_25 = Panel(expression_21)  # disabled
concatenate_2 = Concatenate(FragmentA=panel_23, FragmentB=panel_24, FragmentA_2=panel_25)  # -> flatten(Result); disabled
panel_26 = Panel(concatenate_2)  # disabled
txtwriter_3 = VBScript(filePath=file_path_3, data=flatten(panel_26), activate=button_3)  # -> out, A; inputs data: list; disabled; same code as txtwriter

digit_scroller_7 = DigitScroller(Scroller_Digits=12, Scroller_Prefix="Digit Scroller", Scroller_Radix=4, Scroller_Value=35.45025808)

digit_scroller_8 = DigitScroller(Scroller_Digits=12, Scroller_Prefix="Digit Scroller", Scroller_Radix=4, Scroller_Value=17.44940186)

digit_scroller_9 = DigitScroller(Scroller_Digits=12, Scroller_Prefix="Digit Scroller", Scroller_Radix=3, Scroller_Value=4.391891668)
line_sdl_7 = LineSDL(Start=Point(-2.121093912, 1.99985794, 0), Direction=Vector(0.0625, 0.0625, 0), Length=1)

digit_scroller_10 = DigitScroller(Scroller_Digits=12, Scroller_Prefix="Digit Scroller", Scroller_Radix=3, Scroller_Value=0.549001875)

digit_scroller_11 = DigitScroller(Scroller_Digits=12, Scroller_Prefix="Digit Scroller", Scroller_Radix=3, Scroller_Value=0.03445)
line_sdl_8 = LineSDL(Start=Point(0, 0, 0), Direction=Vector(1, 0, 0), Length=1)

digit_scroller_12 = DigitScroller(Scroller_Digits=12, Scroller_Prefix="Digit Scroller", Scroller_Radix=4, Scroller_Value=88.02530752)

digit_scroller_13 = DigitScroller(Scroller_Digits=12, Scroller_Prefix="Digit Scroller", Scroller_Radix=4, Scroller_Value=67.97875157)

digit_scroller_14 = DigitScroller(Scroller_Digits=12, Scroller_Prefix="Digit Scroller", Scroller_Radix=4, Scroller_Value=59.91624635)

digit_scroller_15 = DigitScroller(Scroller_Digits=12, Scroller_Prefix="Digit Scroller", Scroller_Radix=4, Scroller_Value=34.10949842)

create_material_8 = CreateMaterial(Diffuse=RGB(191, 191, 191), Specular=RGB(0, 255, 255), Emission=RGB(0, 0, 0), Transparency=0.5, Shine=100)

create_material_9 = CreateMaterial(Diffuse=RGB(217, 217, 217), Specular=RGB(0, 255, 255), Emission=RGB(0, 0, 0), Transparency=0.5, Shine=100)

create_material_10 = CreateMaterial(Diffuse=RGB(199, 199, 199), Specular=RGB(0, 255, 255), Emission=RGB(0, 0, 0), Transparency=0.5, Shine=100)

create_material_11 = CreateMaterial(Diffuse=RGB(224, 224, 224), Specular=RGB(0, 255, 255), Emission=RGB(0, 0, 0), Transparency=0.5, Shine=100)

create_material_12 = CreateMaterial(Diffuse=RGB(207, 207, 207), Specular=RGB(0, 255, 255), Emission=RGB(0, 0, 0), Transparency=0.5, Shine=100)

create_material_13 = CreateMaterial(Diffuse=RGB(232, 232, 232), Specular=RGB(0, 255, 255), Emission=RGB(0, 0, 0), Transparency=0.5, Shine=100)

create_material_14 = CreateMaterial(Diffuse=RGB(214, 214, 214), Specular=RGB(0, 255, 255), Emission=RGB(0, 0, 0), Transparency=0.5, Shine=100)

create_material_15 = CreateMaterial(Diffuse=RGB(240, 240, 240), Specular=RGB(0, 255, 255), Emission=RGB(0, 0, 0), Transparency=0.5, Shine=100)

create_material_16 = CreateMaterial(Diffuse=RGB(222, 222, 222), Specular=RGB(0, 255, 255), Emission=RGB(0, 0, 0), Transparency=0.5, Shine=100)

create_material_17 = CreateMaterial(Diffuse=RGB(247, 247, 247), Specular=RGB(0, 255, 255), Emission=RGB(0, 0, 0), Transparency=0.5, Shine=100)

create_material_18 = CreateMaterial(Diffuse=RGB(176, 176, 176), Specular=RGB(0, 255, 255), Emission=RGB(0, 0, 0), Transparency=0.5, Shine=100)

create_material_19 = CreateMaterial(Diffuse=RGB(201, 201, 201), Specular=RGB(0, 255, 255), Emission=RGB(0, 0, 0), Transparency=0.5, Shine=100)

create_material_20 = CreateMaterial(Diffuse=RGB(184, 184, 184), Specular=RGB(0, 255, 255), Emission=RGB(0, 0, 0), Transparency=0.5, Shine=100)

create_material_21 = CreateMaterial(Diffuse=RGB(209, 209, 209), Specular=RGB(0, 255, 255), Emission=RGB(0, 0, 0), Transparency=0.5, Shine=100)

create_material_22 = CreateMaterial(Diffuse=RGB(168, 168, 168), Specular=RGB(0, 255, 255), Emission=RGB(0, 0, 0), Transparency=0.5, Shine=100)

create_material_23 = CreateMaterial(Diffuse=RGB(194, 194, 194), Specular=RGB(0, 255, 255), Emission=RGB(0, 0, 0), Transparency=0.5, Shine=100)

create_material_24 = CreateMaterial(Diffuse=RGB(161, 161, 161), Specular=RGB(0, 255, 255), Emission=RGB(0, 0, 0), Transparency=0.5, Shine=100)

create_material_25 = CreateMaterial(Diffuse=RGB(186, 186, 186), Specular=RGB(0, 255, 255), Emission=RGB(0, 0, 0), Transparency=0.5, Shine=100)

panel_27 = Panel("""0    256    0.0013733120705119695
0    4096    0.0000053644183496292""")
panel_28 = Panel("0.0013733120705119695*4*4")

digit_scroller_16 = DigitScroller(Scroller_Digits=12, Scroller_Prefix="Digit Scroller", Scroller_Radix=1, Scroller_Value=7.49e-08)
radians_2 = Radians(Degrees="0.0000000748925500000001421")

number_9 = Number(Slider(256, range=0..65536))

series_2 = Series(Start=0, Step=radians_2, Count=number_9)
one_over_x_2 = OneOverX(Value=number_9)
duplicate_data_4 = DuplicateData(Data=one_over_x_2, Number=number_9, Order=True)
turtle_2 = DotNETVBScriptLEGACY(Forward=duplicate_data_4, Left=series_2)  # -> Output, Points; inputs Forward: list, Left: list; same code as turtle
point_9 = Point(turtle_2.Points)

interpolate_t_2 = InterpolateT(Vertices=point_9, TangentStart=Vector(0.0625, 0, 0), TangentEnd=Vector(0, 0, 0), KnotStyle=2)  # -> Curve, Length, Domain
evaluate_length_6 = EvaluateLength(Curve=interpolate_t_2.Curve, Length=1, Normalized=True)  # -> Point, Tangent, Parameter
line_sdl_9 = LineSDL(Start=evaluate_length_6.Point, Direction=evaluate_length_6.Tangent, Length=1)
mirror_4 = Mirror(Geometry=interpolate_t_2.Curve, Plane=line_sdl_9)  # -> Geometry, Transform
join_curves_5 = JoinCurves(Curves=[interpolate_t_2.Curve, mirror_4.Geometry], Preserve=False)
evaluate_length_7 = EvaluateLength(Curve=join_curves_5, Length=1, Normalized=True)  # -> Point, Tangent, Parameter
rotate_4 = Rotate(Geometry=join_curves_5, Angle=3.141592654, Plane=evaluate_length_7.Point)  # -> Geometry, Transform
join_curves_6 = JoinCurves(Curves=[join_curves_5, rotate_4.Geometry], Preserve=False)
curve_10 = Curve(join_curves_6)

expression_22 = Expression(O=turtle_2.Points, Expression="FORMAT(\"{0:R}\",O)")
panel_29 = Panel(expression_22)
expression_23 = Expression(O=series_2, Expression="FORMAT(\"{0:R}\",O)")
panel_30 = Panel(expression_23)
evaluate_length_8 = EvaluateLength(Curve=join_curves_6, Length=1, Normalized=True)  # -> Point, Tangent, Parameter
deconstruct_7 = Deconstruct(Point=evaluate_length_8.Point)  # -> XComponent, YComponent, ZComponent
expression_24 = Expression(O=deconstruct_7.YComponent, Expression="FORMAT(\"{0:R}\",O)")
expression_25 = Expression(O=deconstruct_7.XComponent, Expression="FORMAT(\"{0:R}\",O)")
expression_26 = Expression(O=deconstruct_7.ZComponent, Expression="FORMAT(\"{0:R}\",O)")
panel_31 = Panel(expression_24)
panel_32 = Panel(expression_25)
panel_33 = Panel(expression_26)
addition_2 = Addition(A=panel_31, B=panel_32)
expression_27 = Expression(O=addition_2, Expression="FORMAT(\"{0:R}\",O)")
panel_34 = Panel(expression_27)
division_3 = Division(A=panel_34, B=2)
expression_28 = Expression(O=division_3, Expression="FORMAT(\"{0:R}\",O)")
panel_35 = Panel(expression_28)
scale_6 = Scale(Geometry=curve_10, Center=Point(0, 0, 0), Factor=expr("1/X", panel_35))  # -> Geometry, Transform
evaluate_length_9 = EvaluateLength(Curve=scale_6.Geometry, Length=1, Normalized=True)  # -> Point, Tangent, Parameter
deconstruct_8 = Deconstruct(Point=evaluate_length_9.Point)  # -> XComponent, YComponent, ZComponent
expression_29 = Expression(O=deconstruct_8.YComponent, Expression="FORMAT(\"{0:R}\",O)")
expression_30 = Expression(O=deconstruct_8.XComponent, Expression="FORMAT(\"{0:R}\",O)")
expression_31 = Expression(O=deconstruct_8.ZComponent, Expression="FORMAT(\"{0:R}\",O)")
panel_36 = Panel(expression_29)
panel_37 = Panel(expression_30)
panel_38 = Panel(expression_31)
division_4 = Division(A=panel_32, B=panel_31)
expression_32 = Expression(O=division_4, Expression="FORMAT(\"{0:R}\",O)")
panel_39 = Panel(expression_32)
curve_11 = Curve(scale_6.Geometry)

number_10 = Number(number_9)

curve_12 = Curve(curve_11)
end_points = EndPoints(Curve=curve_12)  # -> Start, End
rectangle_2pt = Rectangle2Pt(Plane=PlaneXY(0, 0, 0), PointA=end_points.Start, PointB=end_points.End, Radius=0)  # -> Rectangle, Length
deconstuct_rectangle = DeconstuctRectangle(Rectangle=rectangle_2pt.Rectangle)  # -> BasePlane, XInterval, YInterval
deconstruct_domain_2 = DeconstructDomain(Domain=deconstuct_rectangle.YInterval)  # -> Start, End
deconstruct_domain_3 = DeconstructDomain(Domain=deconstuct_rectangle.XInterval)  # -> Start, End
scale_nu = ScaleNU(
    Geometry=curve_11,
    Plane=PlaneXY(0, 0, 0),
    ScaleX=expr("1/X", deconstruct_domain_3.End),
    ScaleY=expr("1/X", deconstruct_domain_2.End),
    ScaleZ=1)  # -> Geometry, Transform
curve_13 = Curve(scale_nu.Geometry)

digit_scroller_17 = DigitScroller(Scroller_Digits=12, Scroller_Prefix=" ", Scroller_Radix=2, Scroller_Value=30.9312132)
curve_14 = Curve(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)
curve_15 = Curve(curve_11)
scale_7 = Scale(Geometry=curve_15, Center=Point(0, 0, 0), Factor=expr("2^X", "30.93121320041889709"))  # -> Geometry, Transform
curve_16 = Curve(scale_7.Geometry)

curve_17 = Curve(graft(curve_11))  # disabled
divide_curve_5 = DivideCurve(Curve=curve_17, Count=number, Kinks=False)  # -> Points, Tangents, Parameters; disabled
curvature = Curvature(Curve=curve_17, Parameter=divide_curve_5.Parameters)  # -> Point, Curvature, Curvature_2; disabled
deconstruct_arc = DeconstructArc(Arc=curvature.Curvature_2)  # -> BasePlane, Radius, Angle; disabled
expression_33 = Expression(O=deconstruct_arc.Radius, Expression="FORMAT(\"{0:R}\",O)")  # disabled
panel_41 = Panel(expression_33)  # disabled
one_over_x_3 = OneOverX(Value=deconstruct_arc.Radius)  # disabled

expression_34 = Expression(O=one_over_x_3, Expression="FORMAT(\"{0:R}\",O)")  # disabled
panel_42 = Panel(expression_34)  # disabled

quick_graph = QuickGraph(one_over_x_3, SortOrder=0)  # disabled
multiplication = Multiplication(A=one_over_x_3, B=number_slider)  # disabled
line_sdl_10 = LineSDL(Start=divide_curve.Points, Direction=Vector(0, 1, 0), Length=multiplication)  # disabled

curve_18 = Curve(line_sdl_10)  # disabled

curve_19 = Curve(graft(curve_11))  # disabled
divide_curve_6 = DivideCurve(Curve=curve_19, Count=number_2, Kinks=False)  # -> Points, Tangents, Parameters; disabled
curvature_2 = Curvature(Curve=curve_19, Parameter=divide_curve_6.Parameters)  # -> Point, Curvature, Curvature_2; disabled
deconstruct_arc_2 = DeconstructArc(Arc=curvature_2.Curvature_2)  # -> BasePlane, Radius, Angle; disabled
line = Line(StartPoint=curvature_2.Point, EndPoint=deconstruct_arc_2.BasePlane)  # disabled
one_over_x_4 = OneOverX(Value=deconstruct_arc_2.Radius)  # disabled
quick_graph_2 = QuickGraph(one_over_x_4, SortOrder=0)  # disabled
replace_nulls = ReplaceNulls(Items=one_over_x_4, Replacements=0)  # -> Items, Count; disabled
relative_differences = RelativeDifferences(Values=replace_nulls.Items)  # disabled
custom_preview = CustomPreview(Geometry=curve_19, Material=create_material_3)  # disabled
curvature_graph = CurvatureGraph(Curve=curve_19, Density=1, Scale=digit_scroller_4)  # disabled

expression_35 = Expression(O=relative_differences, Expression="FORMAT(\"{0:R}\",O)")  # disabled
panel_43 = Panel(expression_35)  # disabled
quick_graph_3 = QuickGraph(relative_differences, SortOrder=0)  # disabled

expression_36 = Expression(O=one_over_x_4, Expression="FORMAT(\"{0:R}\",O)")  # disabled
panel_44 = Panel(expression_36)  # disabled

expression_37 = Expression(O=deconstruct_arc_2.Radius, Expression="FORMAT(\"{0:R}\",O)")  # disabled
panel_45 = Panel(expression_37)  # disabled

bounds = Bounds(Numbers=relative_differences)  # disabled
remap_numbers = RemapNumbers(Value=relative_differences, Source=bounds, Target=Domain(-1, 1))  # -> Mapped, Clipped; disabled

bounds_2 = Bounds(Numbers=one_over_x_4)  # disabled
remap_numbers_2 = RemapNumbers(Value=one_over_x_4, Source=bounds_2, Target=Domain(0, 1))  # -> Mapped, Clipped; disabled

derivatives = Derivatives(Curve=curve_19, Parameter=divide_curve_6.Parameters)  # -> Point, FirstDerivative, SecondDerivative, ThirdDerivative, FourthDerivative, FifthDerivative, SixthDerivative; disabled
quick_graph_4 = QuickGraph(derivatives.SixthDerivative, SortOrder=0)  # disabled
quick_graph_5 = QuickGraph(derivatives.FifthDerivative, SortOrder=0)  # disabled
quick_graph_6 = QuickGraph(derivatives.FourthDerivative, SortOrder=0)  # disabled
quick_graph_7 = QuickGraph(derivatives.ThirdDerivative, SortOrder=0)  # disabled
quick_graph_8 = QuickGraph(derivatives.SecondDerivative, SortOrder=0)  # disabled
quick_graph_9 = QuickGraph(derivatives.FirstDerivative, SortOrder=0)  # disabled
quick_graph_10 = QuickGraph(derivatives.Point, SortOrder=0)  # disabled
length = Length(Curve=curve_19)  # disabled
multiplication_2 = Multiplication(A=remap_numbers.Mapped, B=length)  # disabled
multiplication_3 = Multiplication(A=length, B=remap_numbers_2.Mapped)  # disabled

multiplication_4 = Multiplication(A=multiplication_2, B=number_slider_2)  # disabled

multiplication_5 = Multiplication(A=multiplication_3, B=number_slider_3)  # disabled

line_sdl_11 = LineSDL(Start=curvature_2.Point, Direction=line, Length=expr("-ABS(X)", multiplication_5))  # disabled
evaluate_length_10 = EvaluateLength(Curve=line_sdl_11, Length=1, Normalized=True)  # -> Point, Tangent, Parameter; disabled
interpolate_2 = Interpolate(Vertices=evaluate_length_10.Point, Degree=3, Periodic=False, KnotStyle=2)  # -> Curve, Length, Domain; disabled
custom_preview_2 = CustomPreview(Geometry=line_sdl_11, Material=create_material_2)  # disabled
curve_20 = Curve(interpolate_2.Curve)  # disabled
custom_preview_3 = CustomPreview(Geometry=curve_20, Material=create_material)  # disabled

line_sdl_12 = LineSDL(Start=evaluate_length_10.Point, Direction=line_sdl_11, Length=expr("ABS(X)", multiplication_4))  # disabled
nurbs_curve_2 = NurbsCurve(Vertices=evaluate_length_10.Point, Degree=3, Periodic=False)  # -> Curve, Length, Domain; disabled
custom_preview_4 = CustomPreview(Geometry=line_sdl_12, Material=create_material_7)  # disabled
curve_21 = Curve(line_sdl_12)  # disabled
evaluate_length_11 = EvaluateLength(Curve=curve_21, Length=1, Normalized=True)  # -> Point, Tangent, Parameter; disabled
interpolate_3 = Interpolate(Vertices=evaluate_length_11.Point, Degree=3, Periodic=False, KnotStyle=2)  # -> Curve, Length, Domain; disabled
line_sdl_13 = LineSDL(Start=evaluate_length_11.Point, Direction=derivatives.ThirdDerivative, Length=expr("-X", multiplication_4))  # disabled
evaluate_length_12 = EvaluateLength(Curve=line_sdl_13, Length=1, Normalized=True)  # -> Point, Tangent, Parameter; disabled
interpolate_4 = Interpolate(Vertices=evaluate_length_12.Point, Degree=3, Periodic=False, KnotStyle=2)  # -> Curve, Length, Domain; disabled
polyline = PolyLine(Vertices=evaluate_length_11.Point, Closed=False)  # disabled
explode = Explode(Curve=polyline, Recursive=True)  # -> Segments, Vertices; disabled
custom_preview_5 = CustomPreview(Geometry=interpolate_4.Curve, Material=create_material_4)  # disabled
custom_preview_6 = CustomPreview(Geometry=line_sdl_13, Material=create_material_5)  # disabled
custom_preview_7 = CustomPreview(Geometry=interpolate_3.Curve, Material=create_material_6)  # disabled
curve_22 = Curve(flatten(explode.Segments))  # disabled
length_2 = Length(Curve=curve_22)  # disabled
sort_list = SortList(Keys=length_2, ValuesValuesA=curve_22)  # -> Keys, ValuesValuesA; disabled
list_item_2 = ListItem(List=sort_list.Keys, Index=0, Wrap=False)  # disabled
dot_display = DotDisplay(Point=evaluate_length_11.Point, Colour=RGB(194, 194, 194), Size=expr("X/2", list_item_2))  # disabled

expression_38 = Expression(O=sort_list.Keys, Expression="FORMAT(\"{0:R}\",O)")  # disabled
panel_46 = Panel(expression_38)  # disabled

number_11 = Number(number_10)

divide_curve_7 = DivideCurve(Curve=line_sdl_8, Count=number_11, Kinks=False)  # -> Points, Tangents, Parameters

digit_scroller_18 = DigitScroller(Scroller_Digits=12, Scroller_Prefix=" ", Scroller_Radix=11, Scroller_Value=256)
digit_scroller_19 = DigitScroller(Scroller_Digits=12, Scroller_Prefix=" ", Scroller_Radix=11, Scroller_Value=90)
create_material_26 = CreateMaterial(Diffuse=RGB(222, 222, 222), Specular=RGB(0, 255, 255), Emission=RGB(0, 0, 0), Transparency=0.5, Shine=100)
create_material_27 = CreateMaterial(Diffuse=RGB(247, 247, 247), Specular=RGB(0, 255, 255), Emission=RGB(0, 0, 0), Transparency=0.5, Shine=100)
create_material_28 = CreateMaterial(Diffuse=RGB(176, 176, 176), Specular=RGB(0, 255, 255), Emission=RGB(0, 0, 0), Transparency=0.5, Shine=100)
number_12 = Number(number_10)
number_13 = Number(number_12)

create_material_29 = CreateMaterial(Diffuse=RGB(161, 161, 161), Specular=RGB(0, 255, 255), Emission=RGB(0, 0, 0), Transparency=0.5, Shine=100)
create_material_30 = CreateMaterial(Diffuse=RGB(186, 186, 186), Specular=RGB(0, 255, 255), Emission=RGB(0, 0, 0), Transparency=0.5, Shine=100)

create_material_31 = CreateMaterial(Diffuse=RGB(168, 168, 168), Specular=RGB(0, 255, 255), Emission=RGB(0, 0, 0), Transparency=0.5, Shine=100)
create_material_32 = CreateMaterial(Diffuse=RGB(194, 194, 194), Specular=RGB(0, 255, 255), Emission=RGB(0, 0, 0), Transparency=0.5, Shine=100)

create_material_33 = CreateMaterial(Diffuse=RGB(176, 176, 176), Specular=RGB(0, 255, 255), Emission=RGB(0, 0, 0), Transparency=0.5, Shine=100)
create_material_34 = CreateMaterial(Diffuse=RGB(201, 201, 201), Specular=RGB(0, 255, 255), Emission=RGB(0, 0, 0), Transparency=0.5, Shine=100)

create_material_35 = CreateMaterial(Diffuse=RGB(184, 184, 184), Specular=RGB(0, 255, 255), Emission=RGB(0, 0, 0), Transparency=0.5, Shine=100)
create_material_36 = CreateMaterial(Diffuse=RGB(209, 209, 209), Specular=RGB(0, 255, 255), Emission=RGB(0, 0, 0), Transparency=0.5, Shine=100)

create_material_37 = CreateMaterial(Diffuse=RGB(191, 191, 191), Specular=RGB(0, 255, 255), Emission=RGB(0, 0, 0), Transparency=0.5, Shine=100)
create_material_38 = CreateMaterial(Diffuse=RGB(217, 217, 217), Specular=RGB(0, 255, 255), Emission=RGB(0, 0, 0), Transparency=0.5, Shine=100)

create_material_39 = CreateMaterial(Diffuse=RGB(199, 199, 199), Specular=RGB(0, 255, 255), Emission=RGB(0, 0, 0), Transparency=0.5, Shine=100)
create_material_40 = CreateMaterial(Diffuse=RGB(224, 224, 224), Specular=RGB(0, 255, 255), Emission=RGB(0, 0, 0), Transparency=0.5, Shine=100)

create_material_41 = CreateMaterial(Diffuse=RGB(207, 207, 207), Specular=RGB(0, 255, 255), Emission=RGB(0, 0, 0), Transparency=0.5, Shine=100)
create_material_42 = CreateMaterial(Diffuse=RGB(232, 232, 232), Specular=RGB(0, 255, 255), Emission=RGB(0, 0, 0), Transparency=0.5, Shine=100)

create_material_43 = CreateMaterial(Diffuse=RGB(214, 214, 214), Specular=RGB(0, 255, 255), Emission=RGB(0, 0, 0), Transparency=0.5, Shine=100)
create_material_44 = CreateMaterial(Diffuse=RGB(240, 240, 240), Specular=RGB(0, 255, 255), Emission=RGB(0, 0, 0), Transparency=0.5, Shine=100)
create_material_45 = CreateMaterial(Diffuse=RGB(207, 207, 207), Specular=RGB(0, 255, 255), Emission=RGB(0, 0, 0), Transparency=0.5, Shine=100)
create_material_46 = CreateMaterial(Diffuse=RGB(232, 232, 232), Specular=RGB(0, 255, 255), Emission=RGB(0, 0, 0), Transparency=0.5, Shine=100)

panel_47 = Panel("0.35721403168191375/4/4")
panel_48 = Panel("""1    16    0.35721403168191375
1    256    0.0014014999884235925
1    4096    """)
digit_scroller_20 = DigitScroller(Scroller_Digits=12, Scroller_Prefix="Digit Scroller", Scroller_Radix=1, Scroller_Value=2e-07)
number_slider_6 = Slider(256, range=0..65536)
radians_3 = Radians(Degrees=digit_scroller_20)

expression_39 = Expression(O=radians_3, Expression="FORMAT(\"{0:0.00000000000000000000}\",O)")
panel_49 = Panel(expression_39)
curve_23 = Curve(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)
number_14 = Number(number_9)

end_points_2 = EndPoints(Curve=curve_16)  # -> Start, End
rectangle_2pt_2 = Rectangle2Pt(Plane=PlaneXY(0, 0, 0), PointA=end_points_2.Start, PointB=end_points_2.End, Radius=0)  # -> Rectangle, Length

one_over_x_5 = OneOverX(Value=number_14)
duplicate_data_5 = DuplicateData(Data=one_over_x_5, Number=number_14, Order=True)
series_3 = Series(Start=0, Step=panel_49, Count=number_14)
expression_40 = Expression(O=series_3, Expression="FORMAT(\"{0:R}\",O)")  # disabled
panel_50 = Panel(expression_40)
bounds_3 = Bounds(Numbers=series_3)

curve_graph_mapper = CurveGraphMapper(Curves=curve_16, Rectangle=rectangle_2pt_2.Rectangle, Values=series_3, Flip=False, Snap=False, TextSize=0.015625)  # -> Mapped, GraphCurves, GraphPoints, ValueLines, ValuePoints, MappedLines, MappedPoints, Boundary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; disabled
graphmapper = GraphMapper(Curve=curve_16, Boundary=rectangle_2pt_2.Rectangle, Numbers=series_3, Input=bounds_3, Output=bounds_3, bobo=False)
stream_filter_2 = StreamFilter(Gate=Slider(1, range=0..1), Stream0=curve_graph_mapper.Mapped, Stream1=graphmapper)

turtle_3 = DotNETVBScriptLEGACY(Forward=duplicate_data_5, Left=stream_filter_2)  # -> Output, Points; inputs Forward: list, Left: list; same code as turtle
point_10 = Point(turtle_3.Points)

expression_41 = Expression(O=turtle_3.Points, Expression="FORMAT(\"{0:R}\",O)")
panel_51 = Panel(expression_41)

interpolate_t_3 = InterpolateT(Vertices=point_10, TangentStart=Vector(0.0625, 0, 0), TangentEnd=Vector(0, 0, 0), KnotStyle=2)  # -> Curve, Length, Domain
evaluate_length_13 = EvaluateLength(Curve=interpolate_t_3.Curve, Length=1, Normalized=True)  # -> Point, Tangent, Parameter
line_sdl_14 = LineSDL(Start=evaluate_length_13.Point, Direction=evaluate_length_13.Tangent, Length=1)
mirror_5 = Mirror(Geometry=interpolate_t_3.Curve, Plane=line_sdl_14)  # -> Geometry, Transform
join_curves_7 = JoinCurves(Curves=[interpolate_t_3.Curve, mirror_5.Geometry], Preserve=False)
evaluate_length_14 = EvaluateLength(Curve=join_curves_7, Length=1, Normalized=True)  # -> Point, Tangent, Parameter
rotate_5 = Rotate(Geometry=join_curves_7, Angle=3.141592654, Plane=evaluate_length_14.Point)  # -> Geometry, Transform
join_curves_8 = JoinCurves(Curves=[join_curves_7, rotate_5.Geometry], Preserve=False)
curve_24 = Curve(join_curves_8)

evaluate_length_15 = EvaluateLength(Curve=join_curves_8, Length=1, Normalized=True)  # -> Point, Tangent, Parameter
deconstruct_9 = Deconstruct(Point=evaluate_length_15.Point)  # -> XComponent, YComponent, ZComponent
expression_42 = Expression(O=deconstruct_9.YComponent, Expression="FORMAT(\"{0:R}\",O)")
expression_43 = Expression(O=deconstruct_9.XComponent, Expression="FORMAT(\"{0:R}\",O)")
expression_44 = Expression(O=deconstruct_9.ZComponent, Expression="FORMAT(\"{0:R}\",O)")
panel_52 = Panel(expression_42)
panel_53 = Panel(expression_43)
panel_54 = Panel(expression_44)
addition_3 = Addition(A=panel_52, B=panel_53)
expression_45 = Expression(O=addition_3, Expression="FORMAT(\"{0:R}\",O)")
panel_55 = Panel(expression_45)
division_5 = Division(A=panel_55, B=2)
expression_46 = Expression(O=division_5, Expression="FORMAT(\"{0:R}\",O)")
panel_56 = Panel(expression_46)
scale_8 = Scale(Geometry=point_10, Center=Point(0, 0, 0), Factor=expr("1/X", panel_56))  # -> Geometry, Transform
scale_9 = Scale(Geometry=curve_24, Center=Point(0, 0, 0), Factor=expr("1/X", panel_56))  # -> Geometry, Transform
evaluate_length_16 = EvaluateLength(Curve=scale_9.Geometry, Length=1, Normalized=True)  # -> Point, Tangent, Parameter
deconstruct_10 = Deconstruct(Point=evaluate_length_16.Point)  # -> XComponent, YComponent, ZComponent
expression_47 = Expression(O=deconstruct_10.YComponent, Expression="FORMAT(\"{0:R}\",O)")
expression_48 = Expression(O=deconstruct_10.XComponent, Expression="FORMAT(\"{0:R}\",O)")
expression_49 = Expression(O=deconstruct_10.ZComponent, Expression="FORMAT(\"{0:R}\",O)")
panel_57 = Panel(expression_47)
panel_58 = Panel(expression_48)
panel_59 = Panel(expression_49)
division_6 = Division(A=panel_53, B=panel_52)
expression_50 = Expression(O=division_6, Expression="FORMAT(\"{0:R}\",O)")
panel_60 = Panel(expression_50)
curve_25 = Curve(scale_9.Geometry)
point_11 = Point(scale_8.Geometry)

move_2 = Move(Geometry=curve_25, Motion=Vector(0, 1, 0))  # -> Geometry, Transform
mirror_6 = Mirror(Geometry=curve_25, Plane=PlaneYZ(0, 0, 0))  # -> Geometry, Transform
curve_26 = Curve(move_2.Geometry)

curve_27 = Curve(curve_25)
end_points_3 = EndPoints(Curve=curve_27)  # -> Start, End
rectangle_2pt_3 = Rectangle2Pt(Plane=PlaneXY(0, 0, 0), PointA=end_points_3.Start, PointB=end_points_3.End, Radius=0)  # -> Rectangle, Length
deconstuct_rectangle_2 = DeconstuctRectangle(Rectangle=rectangle_2pt_3.Rectangle)  # -> BasePlane, XInterval, YInterval
deconstruct_domain_4 = DeconstructDomain(Domain=deconstuct_rectangle_2.YInterval)  # -> Start, End
deconstruct_domain_5 = DeconstructDomain(Domain=deconstuct_rectangle_2.XInterval)  # -> Start, End
scale_nu_2 = ScaleNU(
    Geometry=curve_25,
    Plane=PlaneXY(0, 0, 0),
    ScaleX=expr("1/X", deconstruct_domain_5.End),
    ScaleY=expr("1/X", deconstruct_domain_4.End),
    ScaleZ=1)  # -> Geometry, Transform
curve_28 = Curve(scale_nu_2.Geometry)
move_3 = Move(Geometry=curve_28, Motion=Vector(0, 1, 0))  # -> Geometry, Transform
curve_29 = Curve(move_3.Geometry)

digit_scroller_21 = DigitScroller(Scroller_Digits=12, Scroller_Prefix=" ", Scroller_Radix=2, Scroller_Value=20.9312132)
curve_30 = Curve(curve_25)
scale_10 = Scale(Geometry=curve_30, Center=Point(0, 0, 0), Factor=expr("2^X", "30.93121320041998779"))  # -> Geometry, Transform
curve_31 = Curve(scale_10.Geometry)

digit_scroller_22 = DigitScroller(Scroller_Digits=12, Scroller_Prefix="Digit Scroller", Scroller_Radix=1, Scroller_Value=8.1e-07)
number_slider_7 = Slider(256, range=0..65536)
radians_4 = Radians(Degrees=digit_scroller_22)

expression_51 = Expression(O=radians_4, Expression="FORMAT(\"{0:0.00000000000000000000}\",O)")
panel_64 = Panel(expression_51)
curve_32 = Curve(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)
number_15 = Number(number_9)

end_points_4 = EndPoints(Curve=curve_31)  # -> Start, End
rectangle_2pt_4 = Rectangle2Pt(Plane=PlaneXY(0, 0, 0), PointA=end_points_4.Start, PointB=end_points_4.End, Radius=0)  # -> Rectangle, Length

one_over_x_6 = OneOverX(Value=number_15)
duplicate_data_6 = DuplicateData(Data=one_over_x_6, Number=number_15, Order=True)
series_4 = Series(Start=0, Step=panel_64, Count=number_15)
expression_52 = Expression(O=series_4, Expression="FORMAT(\"{0:R}\",O)")  # disabled
panel_65 = Panel(expression_52)
bounds_4 = Bounds(Numbers=series_4)

curve_graph_mapper_2 = CurveGraphMapper(Curves=curve_31, Rectangle=rectangle_2pt_4.Rectangle, Values=series_4, Flip=False, Snap=True, TextSize=0.015625)  # -> Mapped, GraphCurves, GraphPoints, ValueLines, ValuePoints, MappedLines, MappedPoints, Boundary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; disabled
graphmapper_2 = GraphMapper(Curve=curve_31, Boundary=rectangle_2pt_4.Rectangle, Numbers=series_4, Input=bounds_4, Output=bounds_4, bobo=False)
stream_filter_3 = StreamFilter(Gate=Slider(1, range=0..1), Stream0=curve_graph_mapper_2.Mapped, Stream1=graphmapper_2)

turtle_4 = DotNETVBScriptLEGACY(Forward=duplicate_data_6, Left=stream_filter_3)  # -> Output, Points; inputs Forward: list, Left: list; same code as turtle
point_12 = Point(turtle_4.Points)

expression_53 = Expression(O=turtle_4.Points, Expression="FORMAT(\"{0:R}\",O)")
panel_66 = Panel(expression_53)

interpolate_t_4 = InterpolateT(Vertices=point_12, TangentStart=Vector(0.0625, 0, 0), TangentEnd=Vector(0, 0, 0), KnotStyle=2)  # -> Curve, Length, Domain
evaluate_length_17 = EvaluateLength(Curve=interpolate_t_4.Curve, Length=1, Normalized=True)  # -> Point, Tangent, Parameter
line_sdl_15 = LineSDL(Start=evaluate_length_17.Point, Direction=evaluate_length_17.Tangent, Length=1)
mirror_7 = Mirror(Geometry=interpolate_t_4.Curve, Plane=line_sdl_15)  # -> Geometry, Transform
join_curves_9 = JoinCurves(Curves=[interpolate_t_4.Curve, mirror_7.Geometry], Preserve=False)
evaluate_length_18 = EvaluateLength(Curve=join_curves_9, Length=1, Normalized=True)  # -> Point, Tangent, Parameter
rotate_6 = Rotate(Geometry=join_curves_9, Angle=3.141592654, Plane=evaluate_length_18.Point)  # -> Geometry, Transform
join_curves_10 = JoinCurves(Curves=[join_curves_9, rotate_6.Geometry], Preserve=False)
curve_33 = Curve(join_curves_10)

evaluate_length_19 = EvaluateLength(Curve=join_curves_10, Length=1, Normalized=True)  # -> Point, Tangent, Parameter
deconstruct_11 = Deconstruct(Point=evaluate_length_19.Point)  # -> XComponent, YComponent, ZComponent
expression_54 = Expression(O=deconstruct_11.YComponent, Expression="FORMAT(\"{0:R}\",O)")
expression_55 = Expression(O=deconstruct_11.XComponent, Expression="FORMAT(\"{0:R}\",O)")
expression_56 = Expression(O=deconstruct_11.ZComponent, Expression="FORMAT(\"{0:R}\",O)")
panel_67 = Panel(expression_54)
panel_68 = Panel(expression_55)
panel_69 = Panel(expression_56)
addition_4 = Addition(A=panel_67, B=panel_68)
expression_57 = Expression(O=addition_4, Expression="FORMAT(\"{0:R}\",O)")
panel_70 = Panel(expression_57)
division_7 = Division(A=panel_70, B=2)
expression_58 = Expression(O=division_7, Expression="FORMAT(\"{0:R}\",O)")
panel_71 = Panel(expression_58)
scale_11 = Scale(Geometry=point_12, Center=Point(0, 0, 0), Factor=expr("1/X", panel_71))  # -> Geometry, Transform
scale_12 = Scale(Geometry=curve_33, Center=Point(0, 0, 0), Factor=expr("1/X", panel_71))  # -> Geometry, Transform
evaluate_length_20 = EvaluateLength(Curve=scale_12.Geometry, Length=1, Normalized=True)  # -> Point, Tangent, Parameter
deconstruct_12 = Deconstruct(Point=evaluate_length_20.Point)  # -> XComponent, YComponent, ZComponent
expression_59 = Expression(O=deconstruct_12.YComponent, Expression="FORMAT(\"{0:R}\",O)")
expression_60 = Expression(O=deconstruct_12.XComponent, Expression="FORMAT(\"{0:R}\",O)")
expression_61 = Expression(O=deconstruct_12.ZComponent, Expression="FORMAT(\"{0:R}\",O)")
panel_72 = Panel(expression_59)
panel_73 = Panel(expression_60)
panel_74 = Panel(expression_61)
division_8 = Division(A=panel_68, B=panel_67)
expression_62 = Expression(O=division_8, Expression="FORMAT(\"{0:R}\",O)")
panel_75 = Panel(expression_62)
curve_34 = Curve(scale_12.Geometry)
point_13 = Point(scale_11.Geometry)

move_4 = Move(Geometry=curve_34, Motion=Vector(0, 2, 0))  # -> Geometry, Transform
mirror_8 = Mirror(Geometry=curve_34, Plane=PlaneYZ(0, 0, 0))  # -> Geometry, Transform
curve_35 = Curve(move_4.Geometry)

digit_scroller_23 = DigitScroller(Scroller_Digits=12, Scroller_Prefix=" ", Scroller_Radix=2, Scroller_Value=27.9312132)
curve_36 = Curve(curve_34)
scale_13 = Scale(Geometry=curve_36, Center=Point(0, 0, 0), Factor=expr("2^X", "27.93121320041998779"))  # -> Geometry, Transform
curve_37 = Curve(scale_13.Geometry)

panel_77 = Panel("""3    16    
3    256    0.001373312092932693349
3    4096    """)
digit_scroller_24 = DigitScroller(Scroller_Digits=12, Scroller_Prefix="Digit Scroller", Scroller_Radix=1, Scroller_Value=0.00137331209)
number_slider_8 = Slider(256, range=0..65536)
radians_5 = Radians(Degrees="0.001373312092932693349")

expression_63 = Expression(O=radians_5, Expression="FORMAT(\"{0:0.00000000000000000000}\",O)")
panel_78 = Panel(expression_63)
curve_38 = Curve(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)
number_16 = Number(number_9)

end_points_5 = EndPoints(Curve=curve_37)  # -> Start, End
rectangle_2pt_5 = Rectangle2Pt(Plane=PlaneXY(0, 0, 0), PointA=end_points_5.Start, PointB=end_points_5.End, Radius=0)  # -> Rectangle, Length

one_over_x_7 = OneOverX(Value=number_16)
duplicate_data_7 = DuplicateData(Data=one_over_x_7, Number=number_16, Order=True)
series_5 = Series(Start=0, Step=panel_78, Count=number_16)
expression_64 = Expression(O=series_5, Expression="FORMAT(\"{0:R}\",O)")  # disabled
panel_79 = Panel(expression_64)
bounds_5 = Bounds(Numbers=series_5)

curve_graph_mapper_3 = CurveGraphMapper(Curves=curve_37, Rectangle=rectangle_2pt_5.Rectangle, Values=series_5, Flip=False, Snap=True, TextSize=0.015625)  # -> Mapped, GraphCurves, GraphPoints, ValueLines, ValuePoints, MappedLines, MappedPoints, Boundary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; disabled
graphmapper_3 = GraphMapper(Curve=curve_37, Boundary=rectangle_2pt_5.Rectangle, Numbers=series_5, Input=bounds_5, Output=bounds_5, bobo=False)
stream_filter_4 = StreamFilter(Gate=Slider(1, range=0..1), Stream0=curve_graph_mapper_3.Mapped, Stream1=graphmapper_3)

turtle_5 = DotNETVBScriptLEGACY(Forward=duplicate_data_7, Left=stream_filter_4)  # -> Output, Points; inputs Forward: list, Left: list; same code as turtle
point_14 = Point(turtle_5.Points)

expression_65 = Expression(O=turtle_5.Points, Expression="FORMAT(\"{0:R}\",O)")
panel_80 = Panel(expression_65)

interpolate_t_5 = InterpolateT(Vertices=point_14, TangentStart=Vector(1, 0, 0), TangentEnd=Vector(0, 0, 0), KnotStyle=2)  # -> Curve, Length, Domain
evaluate_length_21 = EvaluateLength(Curve=interpolate_t_5.Curve, Length=1, Normalized=True)  # -> Point, Tangent, Parameter
line_sdl_16 = LineSDL(Start=evaluate_length_21.Point, Direction=evaluate_length_21.Tangent, Length=1)
mirror_9 = Mirror(Geometry=interpolate_t_5.Curve, Plane=line_sdl_16)  # -> Geometry, Transform
join_curves_11 = JoinCurves(Curves=[interpolate_t_5.Curve, mirror_9.Geometry], Preserve=False)
evaluate_length_22 = EvaluateLength(Curve=join_curves_11, Length=1, Normalized=True)  # -> Point, Tangent, Parameter
rotate_7 = Rotate(Geometry=join_curves_11, Angle=3.141592654, Plane=evaluate_length_22.Point)  # -> Geometry, Transform
join_curves_12 = JoinCurves(Curves=[join_curves_11, rotate_7.Geometry], Preserve=False)
curve_39 = Curve(join_curves_12)

evaluate_length_23 = EvaluateLength(Curve=join_curves_12, Length=1, Normalized=True)  # -> Point, Tangent, Parameter
deconstruct_13 = Deconstruct(Point=evaluate_length_23.Point)  # -> XComponent, YComponent, ZComponent
expression_66 = Expression(O=deconstruct_13.YComponent, Expression="FORMAT(\"{0:R}\",O)")
expression_67 = Expression(O=deconstruct_13.XComponent, Expression="FORMAT(\"{0:R}\",O)")
expression_68 = Expression(O=deconstruct_13.ZComponent, Expression="FORMAT(\"{0:R}\",O)")
panel_81 = Panel(expression_66)
panel_82 = Panel(expression_67)
panel_83 = Panel(expression_68)
division_9 = Division(A=panel_82, B=panel_81)
expression_69 = Expression(O=division_9, Expression="FORMAT(\"{0:R}\",O)")
panel_84 = Panel(expression_69)
addition_5 = Addition(A=panel_81, B=panel_82)
expression_70 = Expression(O=addition_5, Expression="FORMAT(\"{0:R}\",O)")
panel_86 = Panel(expression_70)
division_10 = Division(A=panel_86, B=2)
expression_71 = Expression(O=division_10, Expression="FORMAT(\"{0:R}\",O)")
panel_87 = Panel(expression_71)
scale_14 = Scale(Geometry=interpolate_t_5.Curve, Center=Point(0, 0, 0), Factor=expr("1/X", panel_87))  # -> Geometry, Transform; disabled
scale_15 = Scale(Geometry=curve_39, Center=Point(0, 0, 0), Factor=expr("1/X", panel_87))  # -> Geometry, Transform
scale_16 = Scale(Geometry=point_14, Center=Point(0, 0, 0), Factor=expr("1/X", panel_87))  # -> Geometry, Transform
evaluate_length_24 = EvaluateLength(Curve=scale_15.Geometry, Length=1, Normalized=True)  # -> Point, Tangent, Parameter
deconstruct_14 = Deconstruct(Point=evaluate_length_24.Point)  # -> XComponent, YComponent, ZComponent
expression_72 = Expression(O=deconstruct_14.YComponent, Expression="FORMAT(\"{0:R}\",O)")
expression_73 = Expression(O=deconstruct_14.XComponent, Expression="FORMAT(\"{0:R}\",O)")
expression_74 = Expression(O=deconstruct_14.ZComponent, Expression="FORMAT(\"{0:R}\",O)")
panel_88 = Panel(expression_72)
panel_89 = Panel(expression_73)
panel_90 = Panel(expression_74)
point_15 = Point(scale_16.Geometry)
curve_40 = Curve(scale_15.Geometry)

evaluate_length_25 = EvaluateLength(Curve=curve_40, Length=1, Normalized=True)  # -> Point, Tangent, Parameter
yz_plane_2 = YZPlane(Origin=evaluate_length_25.Point)

move_5 = Move(Geometry=curve_40, Motion=Vector(0, 3, 0))  # -> Geometry, Transform
mirror_10 = Mirror(Geometry=curve_40, Plane=yz_plane_2)  # -> Geometry, Transform
curve_41 = Curve(curve_40)

curve_42 = Curve(graft(curve_41))
entwine = Entwine(
    Branch0X=curve_11,
    Branch1X=curve_13,
    Branch2X=curve_26,
    Branch3X=curve_29,
    Branch4X=curve_35,
    Branch5X=curve_41,
    FlattenInputs=False)
join_curves_13 = JoinCurves(Curves=[curve_40, mirror_10.Geometry], Preserve=False)  # disabled

list_length_4 = ListLength(List=curve_42)  # -> flatten(Length)
mass_addition = MassAddition(Input=list_length_4)  # -> Result, PartialResults
panel_91 = Panel(mass_addition.Result)
series_6 = Series(Start=1, Step=1, Count=panel_91)  # -> graft(Series)
vector_xyz = VectorXYZ(XComponent=expr("-X", series_6), YComponent=0, ZComponent=0)  # -> Vector, Length

vector_xyz_2 = VectorXYZ(XComponent=expr("-X", series_6), YComponent=1, ZComponent=0)  # -> Vector, Length

vector_xyz_3 = VectorXYZ(XComponent=expr("-X", series_6), YComponent=0.75, ZComponent=0)  # -> Vector, Length

vector_xyz_4 = VectorXYZ(XComponent=expr("-X", series_6), YComponent=0.5, ZComponent=0)  # -> Vector, Length

vector_xyz_5 = VectorXYZ(XComponent=expr("-X", series_6), YComponent=0.25, ZComponent=0)  # -> Vector, Length

vector_xyz_6 = VectorXYZ(XComponent=expr("-X", series_6), YComponent=1.5, ZComponent=0)  # -> Vector, Length

vector_xyz_7 = VectorXYZ(XComponent=expr("-X", series_6), YComponent=1.25, ZComponent=0)  # -> Vector, Length

vector_xyz_8 = VectorXYZ(XComponent=expr("-X", series_6), YComponent=1.75, ZComponent=0)  # -> Vector, Length

vector_xyz_9 = VectorXYZ(XComponent=expr("-X", series_6), YComponent=2, ZComponent=0)  # -> Vector, Length

curve_43 = Curve(graft(curve_42))
divide_curve_8 = DivideCurve(Curve=curve_43, Count=number_11, Kinks=False)  # -> Points, Tangents, Parameters
curvature_3 = Curvature(Curve=curve_43, Parameter=divide_curve_8.Parameters)  # -> Point, Curvature, Curvature_2
deconstruct_arc_3 = DeconstructArc(Arc=curvature_3.Curvature_2)  # -> BasePlane, Radius, Angle
expression_75 = Expression(O=deconstruct_arc_3.Radius, Expression="FORMAT(\"{0:R}\",O)")  # disabled
panel_92 = Panel(expression_75)
quick_graph_11 = QuickGraph(deconstruct_arc_3.Radius, SortOrder=0)
one_over_x_8 = OneOverX(Value=deconstruct_arc_3.Radius)

expression_76 = Expression(O=one_over_x_8, Expression="FORMAT(\"{0:R}\",O)")  # disabled
panel_93 = Panel(expression_76)

quick_graph_12 = QuickGraph(one_over_x_8, SortOrder=0)
multiplication_6 = Multiplication(A=one_over_x_8, B=digit_scroller_11)
line_sdl_17 = LineSDL(Start=divide_curve_7.Points, Direction=Vector(0, 1, 0), Length=multiplication_6)

replace_nulls_2 = ReplaceNulls(Items=one_over_x_8, Replacements=0)  # -> Items, Count
relative_differences_2 = RelativeDifferences(Values=replace_nulls_2.Items)

expression_77 = Expression(O=relative_differences_2, Expression="FORMAT(\"{0:R}\",O)")  # disabled
panel_94 = Panel(expression_77)
quick_graph_13 = QuickGraph(relative_differences_2, SortOrder=0)
multiplication_7 = Multiplication(A=relative_differences_2, B=digit_scroller_10)
line_sdl_18 = LineSDL(Start=divide_curve_7.Points, Direction=Vector(0, 1, 0), Length=multiplication_7)
move_6 = Move(Geometry=line_sdl_18, Motion=vector_xyz_5.Vector)  # -> Geometry, Transform
evaluate_length_26 = EvaluateLength(Curve=move_6.Geometry, Length=1, Normalized=True)  # -> Point, Tangent, Parameter
interpolate_5 = Interpolate(Vertices=evaluate_length_26.Point, Degree=3, Periodic=False, KnotStyle=2)  # -> Curve, Length, Domain

replace_nulls_3 = ReplaceNulls(Items=relative_differences_2, Replacements=0)  # -> Items, Count
relative_differences_3 = RelativeDifferences(Values=replace_nulls_3.Items)
expression_78 = Expression(O=relative_differences_3, Expression="FORMAT(\"{0:R}\",O)")  # disabled
panel_95 = Panel(expression_78)
quick_graph_14 = QuickGraph(relative_differences_3, SortOrder=0)
multiplication_8 = Multiplication(A=relative_differences_3, B=digit_scroller_9)
line_sdl_19 = LineSDL(Start=divide_curve_7.Points, Direction=Vector(0, 1, 0), Length=multiplication_8)
move_7 = Move(Geometry=line_sdl_19, Motion=vector_xyz_4.Vector)  # -> Geometry, Transform
evaluate_length_27 = EvaluateLength(Curve=move_7.Geometry, Length=1, Normalized=True)  # -> Point, Tangent, Parameter
interpolate_6 = Interpolate(Vertices=evaluate_length_27.Point, Degree=3, Periodic=False, KnotStyle=2)  # -> Curve, Length, Domain

replace_nulls_4 = ReplaceNulls(Items=relative_differences_3, Replacements=0)  # -> Items, Count
relative_differences_4 = RelativeDifferences(Values=replace_nulls_4.Items)
expression_79 = Expression(O=relative_differences_4, Expression="FORMAT(\"{0:R}\",O)")  # disabled
panel_96 = Panel(expression_79)
quick_graph_15 = QuickGraph(relative_differences_4, SortOrder=0)
multiplication_9 = Multiplication(A=relative_differences_4, B=digit_scroller_8)
line_sdl_20 = LineSDL(Start=divide_curve_7.Points, Direction=Vector(0, 1, 0), Length=multiplication_9)
move_8 = Move(Geometry=line_sdl_20, Motion=vector_xyz_3.Vector)  # -> Geometry, Transform
evaluate_length_28 = EvaluateLength(Curve=move_8.Geometry, Length=1, Normalized=True)  # -> Point, Tangent, Parameter
interpolate_7 = Interpolate(Vertices=evaluate_length_28.Point, Degree=3, Periodic=False, KnotStyle=2)  # -> Curve, Length, Domain

replace_nulls_5 = ReplaceNulls(Items=relative_differences_4, Replacements=0)  # -> Items, Count
relative_differences_5 = RelativeDifferences(Values=replace_nulls_5.Items)
expression_80 = Expression(O=relative_differences_5, Expression="FORMAT(\"{0:R}\",O)")  # disabled
panel_97 = Panel(expression_80)
quick_graph_16 = QuickGraph(relative_differences_5, SortOrder=0)
multiplication_10 = Multiplication(A=relative_differences_5, B=digit_scroller_7)
line_sdl_21 = LineSDL(Start=divide_curve_7.Points, Direction=Vector(0, 1, 0), Length=multiplication_10)
move_9 = Move(Geometry=line_sdl_21, Motion=vector_xyz_2.Vector)  # -> Geometry, Transform
evaluate_length_29 = EvaluateLength(Curve=move_9.Geometry, Length=1, Normalized=True)  # -> Point, Tangent, Parameter
interpolate_8 = Interpolate(Vertices=evaluate_length_29.Point, Degree=3, Periodic=False, KnotStyle=2)  # -> Curve, Length, Domain

replace_nulls_6 = ReplaceNulls(Items=relative_differences_5, Replacements=0)  # -> Items, Count
relative_differences_6 = RelativeDifferences(Values=replace_nulls_6.Items)
expression_81 = Expression(O=relative_differences_6, Expression="FORMAT(\"{0:R}\",O)")  # disabled
panel_98 = Panel(expression_81)
quick_graph_17 = QuickGraph(relative_differences_6, SortOrder=0)
multiplication_11 = Multiplication(A=relative_differences_6, B=digit_scroller_12)
line_sdl_22 = LineSDL(Start=divide_curve_7.Points, Direction=Vector(0, 1, 0), Length=multiplication_11)  # disabled
move_10 = Move(Geometry=line_sdl_22, Motion=vector_xyz_7.Vector)  # -> Geometry, Transform
evaluate_length_30 = EvaluateLength(Curve=move_10.Geometry, Length=1, Normalized=True)  # -> Point, Tangent, Parameter
interpolate_9 = Interpolate(Vertices=evaluate_length_30.Point, Degree=3, Periodic=False, KnotStyle=2)  # -> Curve, Length, Domain

replace_nulls_7 = ReplaceNulls(Items=relative_differences_6, Replacements=0)  # -> Items, Count
relative_differences_7 = RelativeDifferences(Values=replace_nulls_7.Items)

expression_82 = Expression(O=relative_differences_7, Expression="FORMAT(\"{0:R}\",O)")  # disabled
panel_99 = Panel(expression_82)
quick_graph_18 = QuickGraph(relative_differences_7, SortOrder=0)
multiplication_12 = Multiplication(A=relative_differences_7, B=digit_scroller_13)
line_sdl_23 = LineSDL(Start=divide_curve_7.Points, Direction=Vector(0, 1, 0), Length=multiplication_12)  # disabled
move_11 = Move(Geometry=line_sdl_23, Motion=vector_xyz_6.Vector)  # -> Geometry, Transform
evaluate_length_31 = EvaluateLength(Curve=move_11.Geometry, Length=1, Normalized=True)  # -> Point, Tangent, Parameter
interpolate_10 = Interpolate(Vertices=evaluate_length_31.Point, Degree=3, Periodic=False, KnotStyle=2)  # -> Curve, Length, Domain

replace_nulls_8 = ReplaceNulls(Items=relative_differences_7, Replacements=0)  # -> Items, Count
relative_differences_8 = RelativeDifferences(Values=replace_nulls_8.Items)
expression_83 = Expression(O=relative_differences_8, Expression="FORMAT(\"{0:R}\",O)")  # disabled
panel_100 = Panel(expression_83)
quick_graph_19 = QuickGraph(relative_differences_8, SortOrder=0)
multiplication_13 = Multiplication(A=relative_differences_8, B=digit_scroller_14)
line_sdl_24 = LineSDL(Start=divide_curve_7.Points, Direction=Vector(0, 1, 0), Length=multiplication_13)  # disabled
move_12 = Move(Geometry=line_sdl_24, Motion=vector_xyz_8.Vector)  # -> Geometry, Transform
evaluate_length_32 = EvaluateLength(Curve=move_12.Geometry, Length=1, Normalized=True)  # -> Point, Tangent, Parameter
interpolate_11 = Interpolate(Vertices=evaluate_length_32.Point, Degree=3, Periodic=False, KnotStyle=2)  # -> Curve, Length, Domain

replace_nulls_9 = ReplaceNulls(Items=relative_differences_8, Replacements=0)  # -> Items, Count
relative_differences_9 = RelativeDifferences(Values=replace_nulls_9.Items)
expression_84 = Expression(O=relative_differences_9, Expression="FORMAT(\"{0:R}\",O)")  # disabled
panel_101 = Panel(expression_84)
quick_graph_20 = QuickGraph(relative_differences_9, SortOrder=0)
multiplication_14 = Multiplication(A=relative_differences_9, B=digit_scroller_15)
line_sdl_25 = LineSDL(Start=divide_curve_7.Points, Direction=Vector(0, 1, 0), Length=multiplication_14)  # disabled
move_13 = Move(Geometry=line_sdl_25, Motion=vector_xyz_9.Vector)  # -> Geometry, Transform
evaluate_length_33 = EvaluateLength(Curve=move_13.Geometry, Length=1, Normalized=True)  # -> Point, Tangent, Parameter
interpolate_12 = Interpolate(Vertices=evaluate_length_33.Point, Degree=3, Periodic=False, KnotStyle=2)  # -> Curve, Length, Domain

custom_preview_8 = CustomPreview(Geometry=interpolate_8.Curve, Material=create_material_8)

custom_preview_9 = CustomPreview(Geometry=move_9.Geometry, Material=create_material_9)

custom_preview_10 = CustomPreview(Geometry=interpolate_7.Curve, Material=create_material_10)

custom_preview_11 = CustomPreview(Geometry=move_8.Geometry, Material=create_material_11)

custom_preview_12 = CustomPreview(Geometry=interpolate_6.Curve, Material=create_material_12)

custom_preview_13 = CustomPreview(Geometry=move_7.Geometry, Material=create_material_13)

custom_preview_14 = CustomPreview(Geometry=interpolate_5.Curve, Material=create_material_14)

custom_preview_15 = CustomPreview(Geometry=move_6.Geometry, Material=create_material_15)

custom_preview_16 = CustomPreview(Geometry=interpolate_10.Curve, Material=create_material_18)

custom_preview_17 = CustomPreview(Geometry=move_11.Geometry, Material=create_material_19)

custom_preview_18 = CustomPreview(Geometry=interpolate_9.Curve, Material=create_material_20)

custom_preview_19 = CustomPreview(Geometry=move_10.Geometry, Material=create_material_21)

custom_preview_20 = CustomPreview(Geometry=interpolate_11.Curve, Material=create_material_22)

custom_preview_21 = CustomPreview(Geometry=move_12.Geometry, Material=create_material_23)

custom_preview_22 = CustomPreview(Geometry=interpolate_12.Curve, Material=create_material_24)

custom_preview_23 = CustomPreview(Geometry=move_13.Geometry, Material=create_material_25)

curve_44 = Curve(line_sdl_17)

move_14 = Move(Geometry=curve_44, Motion=vector_xyz.Vector)  # -> Geometry, Transform
evaluate_length_34 = EvaluateLength(Curve=move_14.Geometry, Length=1, Normalized=True)  # -> Point, Tangent, Parameter
interpolate_13 = Interpolate(Vertices=evaluate_length_34.Point, Degree=3, Periodic=False, KnotStyle=2)  # -> Curve, Length, Domain

custom_preview_24 = CustomPreview(Geometry=interpolate_13.Curve, Material=create_material_16)

custom_preview_25 = CustomPreview(Geometry=move_14.Geometry, Material=create_material_17)

curve_45 = Curve(graft(curve_42))
divide_curve_9 = DivideCurve(Curve=curve_45, Count=number_12, Kinks=False)  # -> Points, Tangents, Parameters
curvature_4 = Curvature(Curve=curve_45, Parameter=divide_curve_9.Parameters)  # -> Point, Curvature, Curvature_2
deconstruct_arc_4 = DeconstructArc(Arc=curvature_4.Curvature_2)  # -> BasePlane, Radius, Angle
line_2 = Line(StartPoint=curvature_4.Point, EndPoint=deconstruct_arc_4.BasePlane)
one_over_x_9 = OneOverX(Value=deconstruct_arc_4.Radius)
quick_graph_21 = QuickGraph(one_over_x_9, SortOrder=0)
replace_nulls_10 = ReplaceNulls(Items=one_over_x_9, Replacements=0)  # -> Items, Count
relative_differences_10 = RelativeDifferences(Values=replace_nulls_10.Items)
custom_preview_26 = CustomPreview(Geometry=curve_45, Material=create_material_28)
curvature_graph_2 = CurvatureGraph(Curve=curve_45, Density=1, Scale=digit_scroller_19)

expression_85 = Expression(O=relative_differences_10, Expression="FORMAT(\"{0:R}\",O)")  # disabled
panel_102 = Panel(expression_85)
quick_graph_22 = QuickGraph(relative_differences_10, SortOrder=0)

expression_86 = Expression(O=one_over_x_9, Expression="FORMAT(\"{0:R}\",O)")  # disabled
panel_103 = Panel(expression_86)

expression_87 = Expression(O=deconstruct_arc_4.Radius, Expression="FORMAT(\"{0:R}\",O)")  # disabled
panel_104 = Panel(expression_87)

relative_differences_11 = RelativeDifferences(Values=relative_differences_10)

quick_graph_23 = QuickGraph(relative_differences_11, SortOrder=0)
bounds_6 = Bounds(Numbers=relative_differences_11)
remap_numbers_3 = RemapNumbers(Value=relative_differences_11, Source=bounds_6, Target=Domain(-1, 1))  # -> Mapped, Clipped

relative_differences_12 = RelativeDifferences(Values=relative_differences_11)

quick_graph_24 = QuickGraph(relative_differences_12, SortOrder=0)
bounds_7 = Bounds(Numbers=relative_differences_12)
remap_numbers_4 = RemapNumbers(Value=relative_differences_12, Source=bounds_7, Target=Domain(-1, 1))  # -> Mapped, Clipped

relative_differences_13 = RelativeDifferences(Values=relative_differences_12)

quick_graph_25 = QuickGraph(relative_differences_13, SortOrder=0)
bounds_8 = Bounds(Numbers=relative_differences_13)
remap_numbers_5 = RemapNumbers(Value=relative_differences_13, Source=bounds_8, Target=Domain(-1, 1))  # -> Mapped, Clipped

relative_differences_14 = RelativeDifferences(Values=relative_differences_13)

relative_differences_15 = RelativeDifferences(Values=relative_differences_14)

quick_graph_26 = QuickGraph(relative_differences_15, SortOrder=0)
bounds_9 = Bounds(Numbers=relative_differences_15)
remap_numbers_6 = RemapNumbers(Value=relative_differences_15, Source=bounds_9, Target=Domain(-1, 1))  # -> Mapped, Clipped

relative_differences_16 = RelativeDifferences(Values=relative_differences_15)

quick_graph_27 = QuickGraph(relative_differences_16, SortOrder=0)
bounds_10 = Bounds(Numbers=relative_differences_16)
remap_numbers_7 = RemapNumbers(Value=relative_differences_16, Source=bounds_10, Target=Domain(-1, 1))  # -> Mapped, Clipped

relative_differences_17 = RelativeDifferences(Values=relative_differences_16)

quick_graph_28 = QuickGraph(relative_differences_17, SortOrder=0)
bounds_11 = Bounds(Numbers=relative_differences_17)
remap_numbers_8 = RemapNumbers(Value=relative_differences_17, Source=bounds_11, Target=Domain(-1, 1))  # -> Mapped, Clipped

quick_graph_29 = QuickGraph(relative_differences_14, SortOrder=0)
bounds_12 = Bounds(Numbers=relative_differences_14)
remap_numbers_9 = RemapNumbers(Value=relative_differences_14, Source=bounds_12, Target=Domain(-1, 1))  # -> Mapped, Clipped

bounds_13 = Bounds(Numbers=relative_differences_10)
remap_numbers_10 = RemapNumbers(Value=relative_differences_10, Source=bounds_13, Target=Domain(-1, 1))  # -> Mapped, Clipped

bounds_14 = Bounds(Numbers=one_over_x_9)
remap_numbers_11 = RemapNumbers(Value=one_over_x_9, Source=bounds_14, Target=Domain(0, 1))  # -> Mapped, Clipped

length_3 = Length(Curve=curve_45)
multiplication_15 = Multiplication(A=remap_numbers_10.Mapped, B=length_3)
multiplication_16 = Multiplication(A=length_3, B=remap_numbers_11.Mapped)
derivatives_2 = Derivatives(Curve=curve_45, Parameter=divide_curve_9.Parameters)  # -> Point, FirstDerivative, SecondDerivative, ThirdDerivative, FourthDerivative, FifthDerivative, SixthDerivative; disabled
quick_graph_30 = QuickGraph(derivatives_2.SixthDerivative, SortOrder=0)
quick_graph_31 = QuickGraph(derivatives_2.FifthDerivative, SortOrder=0)
quick_graph_32 = QuickGraph(derivatives_2.FourthDerivative, SortOrder=0)
quick_graph_33 = QuickGraph(derivatives_2.ThirdDerivative, SortOrder=0)
quick_graph_34 = QuickGraph(derivatives_2.SecondDerivative, SortOrder=0)
quick_graph_35 = QuickGraph(derivatives_2.FirstDerivative, SortOrder=0)
quick_graph_36 = QuickGraph(derivatives_2.Point, SortOrder=0)

multiplication_17 = Multiplication(A=multiplication_15, B=Slider(0.020588, range=0..1))

multiplication_18 = Multiplication(A=multiplication_16, B=Slider(0.04375, range=0..2))

line_sdl_26 = LineSDL(Start=curvature_4.Point, Direction=line_2, Length=expr("-X", multiplication_18))
evaluate_length_35 = EvaluateLength(Curve=line_sdl_26, Length=1, Normalized=True)  # -> Point, Tangent, Parameter
interpolate_14 = Interpolate(Vertices=evaluate_length_35.Point, Degree=3, Periodic=False, KnotStyle=2)  # -> Curve, Length, Domain
custom_preview_27 = CustomPreview(Geometry=line_sdl_26, Material=create_material_27)
curve_46 = Curve(interpolate_14.Curve)
custom_preview_28 = CustomPreview(Geometry=curve_46, Material=create_material_26)

line_sdl_27 = LineSDL(Start=evaluate_length_35.Point, Direction=line_sdl_26, Length=expr("ABS(X)", multiplication_17))
nurbs_curve_3 = NurbsCurve(Vertices=evaluate_length_35.Point, Degree=3, Periodic=False)  # -> Curve, Length, Domain
custom_preview_29 = CustomPreview(Geometry=line_sdl_27, Material=create_material_44)
curve_47 = Curve(line_sdl_27)
evaluate_length_36 = EvaluateLength(Curve=curve_47, Length=1, Normalized=True)  # -> Point, Tangent, Parameter
interpolate_15 = Interpolate(Vertices=evaluate_length_36.Point, Degree=3, Periodic=False, KnotStyle=2)  # -> Curve, Length, Domain
polyline_2 = PolyLine(Vertices=evaluate_length_36.Point, Closed=False)
explode_2 = Explode(Curve=polyline_2, Recursive=True)  # -> Segments, Vertices
custom_preview_30 = CustomPreview(Geometry=interpolate_15.Curve, Material=create_material_43)
curve_48 = Curve(flatten(explode_2.Segments))
length_4 = Length(Curve=curve_48)
sort_list_2 = SortList(Keys=length_4, ValuesValuesA=curve_48)  # -> Keys, ValuesValuesA
list_item_3 = ListItem(List=sort_list_2.Keys, Index=0, Wrap=False)
dot_display_2 = DotDisplay(Point=evaluate_length_36.Point, Colour=RGB(194, 194, 194), Size=expr("X/2", list_item_3))
line_sdl_28 = LineSDL(Start=evaluate_length_36.Point, Direction=derivatives_2.ThirdDerivative, Length=expr("-X", multiplication_17))
evaluate_length_37 = EvaluateLength(Curve=line_sdl_28, Length=1, Normalized=True)  # -> Point, Tangent, Parameter
interpolate_16 = Interpolate(Vertices=evaluate_length_37.Point, Degree=3, Periodic=False, KnotStyle=2)  # -> Curve, Length, Domain
custom_preview_31 = CustomPreview(Geometry=interpolate_16.Curve, Material=create_material_45)
custom_preview_32 = CustomPreview(Geometry=line_sdl_28, Material=create_material_46)

expression_88 = Expression(O=sort_list_2.Keys, Expression="FORMAT(\"{0:R}\",O)")  # disabled
panel_105 = Panel(expression_88)

multiplication_19 = Multiplication(A=remap_numbers_3.Mapped, B=length_3)
multiplication_20 = Multiplication(A=multiplication_19, B=Slider(0.01573, range=0..1))
line_sdl_29 = LineSDL(Start=evaluate_length_36.Point, Direction=line_sdl_26, Length=expr("ABS(X)", multiplication_20))

evaluate_length_38 = EvaluateLength(Curve=line_sdl_29, Length=1, Normalized=True)  # -> Point, Tangent, Parameter
interpolate_17 = Interpolate(Vertices=evaluate_length_38.Point, Degree=3, Periodic=False, KnotStyle=2)  # -> Curve, Length, Domain
custom_preview_33 = CustomPreview(Geometry=interpolate_17.Curve, Material=create_material_41)
custom_preview_34 = CustomPreview(Geometry=line_sdl_29, Material=create_material_42)

multiplication_21 = Multiplication(A=remap_numbers_4.Mapped, B=length_3)
multiplication_22 = Multiplication(A=multiplication_21, B=Slider(0.0125, range=0..1))
line_sdl_30 = LineSDL(Start=evaluate_length_38.Point, Direction=line_sdl_26, Length=expr("ABS(X)", multiplication_22))

evaluate_length_39 = EvaluateLength(Curve=line_sdl_30, Length=1, Normalized=True)  # -> Point, Tangent, Parameter
interpolate_18 = Interpolate(Vertices=evaluate_length_39.Point, Degree=3, Periodic=False, KnotStyle=2)  # -> Curve, Length, Domain
custom_preview_35 = CustomPreview(Geometry=interpolate_18.Curve, Material=create_material_39)
custom_preview_36 = CustomPreview(Geometry=line_sdl_30, Material=create_material_40)

multiplication_23 = Multiplication(A=remap_numbers_5.Mapped, B=length_3)
multiplication_24 = Multiplication(A=multiplication_23, B=digit_scroller_2)
line_sdl_31 = LineSDL(Start=evaluate_length_39.Point, Direction=line_sdl_26, Length=expr("ABS(X)", multiplication_24))

evaluate_length_40 = EvaluateLength(Curve=line_sdl_31, Length=1, Normalized=True)  # -> Point, Tangent, Parameter
interpolate_19 = Interpolate(Vertices=evaluate_length_40.Point, Degree=3, Periodic=False, KnotStyle=2)  # -> Curve, Length, Domain
custom_preview_37 = CustomPreview(Geometry=interpolate_19.Curve, Material=create_material_37)
custom_preview_38 = CustomPreview(Geometry=line_sdl_31, Material=create_material_38)

multiplication_25 = Multiplication(A=remap_numbers_9.Mapped, B=length_3)
multiplication_26 = Multiplication(A=multiplication_25, B=Slider(0.015625, range=0..1))
line_sdl_32 = LineSDL(Start=evaluate_length_40.Point, Direction=line_sdl_26, Length=expr("ABS(X)", multiplication_26))  # disabled

evaluate_length_41 = EvaluateLength(Curve=line_sdl_32, Length=1, Normalized=True)  # -> Point, Tangent, Parameter
interpolate_20 = Interpolate(Vertices=evaluate_length_41.Point, Degree=3, Periodic=False, KnotStyle=2)  # -> Curve, Length, Domain
custom_preview_39 = CustomPreview(Geometry=interpolate_20.Curve, Material=create_material_35)
custom_preview_40 = CustomPreview(Geometry=line_sdl_32, Material=create_material_36)

multiplication_27 = Multiplication(A=remap_numbers_6.Mapped, B=length_3)
multiplication_28 = Multiplication(A=multiplication_27, B=Slider(0.125, range=0..1))
line_sdl_33 = LineSDL(Start=evaluate_length_41.Point, Direction=line_sdl_26, Length=expr("ABS(X)", multiplication_28))  # disabled

evaluate_length_42 = EvaluateLength(Curve=line_sdl_33, Length=1, Normalized=True)  # -> Point, Tangent, Parameter
interpolate_21 = Interpolate(Vertices=evaluate_length_42.Point, Degree=3, Periodic=False, KnotStyle=2)  # -> Curve, Length, Domain
custom_preview_41 = CustomPreview(Geometry=interpolate_21.Curve, Material=create_material_33)
custom_preview_42 = CustomPreview(Geometry=line_sdl_33, Material=create_material_34)

multiplication_29 = Multiplication(A=remap_numbers_7.Mapped, B=length_3)
multiplication_30 = Multiplication(A=multiplication_29, B=Slider(1, range=0..4))
line_sdl_34 = LineSDL(Start=evaluate_length_42.Point, Direction=line_sdl_26, Length=expr("ABS(X)", multiplication_30))  # disabled

evaluate_length_43 = EvaluateLength(Curve=line_sdl_34, Length=1, Normalized=True)  # -> Point, Tangent, Parameter
interpolate_22 = Interpolate(Vertices=evaluate_length_43.Point, Degree=3, Periodic=False, KnotStyle=2)  # -> Curve, Length, Domain
custom_preview_43 = CustomPreview(Geometry=interpolate_22.Curve, Material=create_material_31)
custom_preview_44 = CustomPreview(Geometry=line_sdl_34, Material=create_material_32)

multiplication_31 = Multiplication(A=remap_numbers_8.Mapped, B=length_3)
multiplication_32 = Multiplication(A=multiplication_31, B=Slider(0.25, range=0..4))
line_sdl_35 = LineSDL(Start=evaluate_length_43.Point, Direction=line_sdl_26, Length=expr("ABS(X)", multiplication_32))  # disabled

evaluate_length_44 = EvaluateLength(Curve=line_sdl_35, Length=1, Normalized=True)  # -> Point, Tangent, Parameter
interpolate_23 = Interpolate(Vertices=evaluate_length_44.Point, Degree=3, Periodic=False, KnotStyle=2)  # -> Curve, Length, Domain
custom_preview_45 = CustomPreview(Geometry=interpolate_23.Curve, Material=create_material_29)
custom_preview_46 = CustomPreview(Geometry=line_sdl_35, Material=create_material_30)

merge_4 = Merge(
    Data1=interpolate_19.Curve,
    Data2=interpolate_13.Curve,
    Data3=interpolate_5.Curve,
    Data4=interpolate_6.Curve,
    Data5=interpolate_7.Curve,
    Data6=interpolate_8.Curve)
bounding_box = BoundingBox(Content=merge_4, Plane=PlaneXY(0, 0, 0), UnionBox=True)  # -> Box, Box_2

panel_106 = Panel("0.0014014999884235925")  # disabled
panel_107 = Panel("""1    16    0.35721403168191375
1    256    0.0014014999884235925
1    4096    """)  # disabled
digit_scroller_25 = DigitScroller(Scroller_Digits=12, Scroller_Prefix="Digit Scroller", Scroller_Radix=1, Scroller_Value=0.00140216731)  # disabled
number_slider_9 = Slider(256, range=0..65536)  # disabled
radians_6 = Radians(Degrees=panel_106)  # disabled

expression_89 = Expression(O=radians_6, Expression="FORMAT(\"{0:0.00000000000000000000}\",O)")  # disabled
panel_108 = Panel(expression_89)  # disabled
curve_49 = Curve(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)  # disabled
number_17 = Number(number_slider_9)  # disabled

number_slider_10 = Slider(1, range=0..1)  # disabled
end_points_6 = EndPoints(Curve=curve_49)  # -> Start, End; disabled
rectangle_2pt_6 = Rectangle2Pt(Plane=PlaneXY(0, 0, 0), PointA=end_points_6.Start, PointB=end_points_6.End, Radius=0)  # -> Rectangle, Length; disabled

series_7 = Series(Start=0, Step=panel_108, Count=number_17)  # disabled
expression_90 = Expression(O=series_7, Expression="FORMAT(\"{0:R}\",O)")  # disabled
panel_109 = Panel(expression_90)  # disabled
bounds_15 = Bounds(Numbers=panel_109)  # disabled
one_over_x_10 = OneOverX(Value=number_17)  # disabled
duplicate_data_8 = DuplicateData(Data=one_over_x_10, Number=number_17, Order=True)  # disabled

curve_graph_mapper_4 = CurveGraphMapper(Curves=curve_49, Rectangle=rectangle_2pt_6.Rectangle, Values=series_7, Flip=False, Snap=False, TextSize=0.015625)  # -> Mapped, GraphCurves, GraphPoints, ValueLines, ValuePoints, MappedLines, MappedPoints, Boundary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; disabled
graphmapper_4 = GraphMapper(Curve=curve_49, Boundary=rectangle_2pt_6.Rectangle, Numbers=series_7, Input=bounds_15, Output=bounds_15, bobo=False)  # disabled
stream_filter_5 = StreamFilter(Gate=number_slider_10, Stream0=curve_graph_mapper_4.Mapped, Stream1=graphmapper_4)  # disabled

turtle_6 = DotNETVBScriptLEGACY(Forward=duplicate_data_8, Left=stream_filter_5)  # -> Output, Points; inputs Forward: list, Left: list; disabled; same code as turtle
point_16 = Point(turtle_6.Points)  # disabled

expression_91 = Expression(O=turtle_6.Points, Expression="FORMAT(\"{0:R}\",O)")  # disabled
panel_110 = Panel(expression_91)  # disabled

interpolate_t_6 = InterpolateT(Vertices=point_16, TangentStart=Vector(0.0625, 0, 0), TangentEnd=Vector(0, 0, 0), KnotStyle=2)  # -> Curve, Length, Domain; disabled
evaluate_length_45 = EvaluateLength(Curve=interpolate_t_6.Curve, Length=1, Normalized=True)  # -> Point, Tangent, Parameter; disabled
line_sdl_36 = LineSDL(Start=evaluate_length_45.Point, Direction=evaluate_length_45.Tangent, Length=1)  # disabled
mirror_11 = Mirror(Geometry=interpolate_t_6.Curve, Plane=line_sdl_36)  # -> Geometry, Transform; disabled
join_curves_14 = JoinCurves(Curves=[interpolate_t_6.Curve, mirror_11.Geometry], Preserve=False)  # disabled
evaluate_length_46 = EvaluateLength(Curve=join_curves_14, Length=1, Normalized=True)  # -> Point, Tangent, Parameter; disabled
rotate_8 = Rotate(Geometry=join_curves_14, Angle=3.141592654, Plane=evaluate_length_46.Point)  # -> Geometry, Transform; disabled
join_curves_15 = JoinCurves(Curves=[join_curves_14, rotate_8.Geometry], Preserve=False)  # disabled
curve_50 = Curve(join_curves_15)  # disabled

evaluate_length_47 = EvaluateLength(Curve=join_curves_15, Length=1, Normalized=True)  # -> Point, Tangent, Parameter; disabled
deconstruct_15 = Deconstruct(Point=evaluate_length_47.Point)  # -> XComponent, YComponent, ZComponent; disabled
expression_92 = Expression(O=deconstruct_15.YComponent, Expression="FORMAT(\"{0:R}\",O)")  # disabled
expression_93 = Expression(O=deconstruct_15.XComponent, Expression="FORMAT(\"{0:R}\",O)")  # disabled
expression_94 = Expression(O=deconstruct_15.ZComponent, Expression="FORMAT(\"{0:R}\",O)")  # disabled
panel_111 = Panel(expression_92)  # disabled
panel_112 = Panel(expression_93)  # disabled
panel_113 = Panel(expression_94)  # disabled
addition_6 = Addition(A=panel_111, B=panel_112)  # disabled
expression_95 = Expression(O=addition_6, Expression="FORMAT(\"{0:R}\",O)")  # disabled
panel_114 = Panel(expression_95)  # disabled
division_11 = Division(A=panel_114, B=2)  # disabled
expression_96 = Expression(O=division_11, Expression="FORMAT(\"{0:R}\",O)")  # disabled
panel_115 = Panel(expression_96)  # disabled
scale_17 = Scale(Geometry=point_16, Center=Point(0, 0, 0), Factor=expr("1/X", panel_115))  # -> Geometry, Transform; disabled
scale_18 = Scale(Geometry=curve_50, Center=Point(0, 0, 0), Factor=expr("1/X", panel_115))  # -> Geometry, Transform; disabled
evaluate_length_48 = EvaluateLength(Curve=scale_18.Geometry, Length=1, Normalized=True)  # -> Point, Tangent, Parameter; disabled
deconstruct_16 = Deconstruct(Point=evaluate_length_48.Point)  # -> XComponent, YComponent, ZComponent; disabled
expression_97 = Expression(O=deconstruct_16.YComponent, Expression="FORMAT(\"{0:R}\",O)")  # disabled
expression_98 = Expression(O=deconstruct_16.XComponent, Expression="FORMAT(\"{0:R}\",O)")  # disabled
expression_99 = Expression(O=deconstruct_16.ZComponent, Expression="FORMAT(\"{0:R}\",O)")  # disabled
panel_116 = Panel(expression_97)  # disabled
panel_117 = Panel(expression_98)  # disabled
panel_118 = Panel(expression_99)  # disabled
division_12 = Division(A=panel_112, B=panel_111)  # disabled
expression_100 = Expression(O=division_12, Expression="FORMAT(\"{0:R}\",O)")  # disabled
panel_119 = Panel(expression_100)  # disabled
curve_51 = Curve(scale_18.Geometry)  # disabled
point_17 = Point(scale_17.Geometry)  # disabled
