# Grasshopper definition XHG..⠀⠀⠀⠀ⵙ옷✤ⓄᙏᔓᔕⵙᙁᗱᗴᗯᗱᗴᙁⵙⵈⵙᗝꖴⓄᙏᕤᕦꖴᔓᔕⵙᗱᗴᴥᑎ✤ᗩᗯᴥᑎᑐᑕⵙᴥᗩᗱᗴИNꖴᙁⵙᗝᗱᗴߦᗩᙏⵙᔓᔕᗱᗴᙏꖴ✤ⵙ∷ⵙИNⓄꖴ✤ꖴᔓᔕИNᗩᴥ✤ⵙᗱᗴᕤᕦᗝᗱᗴⵙᙁᑎꗳⵙ⠀⠀⠀⠀◯⠀⠀⠀⠀ⵙ⠀⠀⠀⠀◯⠀⠀⠀⠀ⵙꗳᑎᙁⵙᗱᗴᗝᕤᕦᗱᗴⵙ✤ᴥᗩИNᔓᔕꖴ✤ꖴⓄИNⵙ∷ⵙ✤ꖴᙏᗱᗴᔓᔕⵙᙏᗩߦᗱᗴᗝⵙᙁꖴИNᗱᗴᗩᴥⵙᑐᑕᑎᴥᗯᗩ✤ᑎᴥᗱᗴⵙᔓᔕꖴᕤᕦᙏⓄꖴᗝⵙⵈⵙᙁᗱᗴᗯᗱᗴᙁⵙᔓᔕᙏⓄ✤옷ⵙ⠀⠀⠀⠀..GHX (Grasshopper 1.0.7)
# plug-ins: Pufferfish, Heteroptera

panel = Panel("0.0000710748925500000001421")
panel_2 = Panel("0.0013733120705119695")
panel_4 = Panel("0.00000331207")
panel_5 = Panel("0.00137956207")
digit_scroller = DigitScroller(Scroller_Digits=12, Scroller_Prefix="Digit Scroller", Scroller_Radix=1, Scroller_Value=0.02196259374)
panel_7 = Panel(digit_scroller)
digit_scroller_2 = DigitScroller(Scroller_Digits=12, Scroller_Prefix="Digit Scroller", Scroller_Radix=1, Scroller_Value=7.7777e-05)
xz_plane = XZPlane(Origin=Point(0, 0, 0))
point = Point(Point(0.5, 0, 0))
yz_plane = YZPlane(Origin=point)
curve = Curve()
panel_9 = Panel("""0.00032220000
0.00000220000""")
panel_10 = Panel("0.00137956207*4*4*4*4")

digit_scroller_3 = DigitScroller(Scroller_Digits=12, Scroller_Prefix=" ", Scroller_Radix=6, Scroller_Value=0.13)

digit_scroller_4 = DigitScroller(Scroller_Digits=12, Scroller_Prefix=" ", Scroller_Radix=6, Scroller_Value=0.1)

digit_scroller_5 = DigitScroller(Scroller_Digits=12, Scroller_Prefix=" ", Scroller_Radix=3, Scroller_Value=0.17)

digit_scroller_6 = DigitScroller(Scroller_Digits=12, Scroller_Prefix="Digit Scroller", Scroller_Radix=9, Scroller_Value=57.5)

digit_scroller_7 = DigitScroller(Scroller_Digits=12, Scroller_Prefix="Digit Scroller", Scroller_Radix=1, Scroller_Value=7.5243e-06)
digit_scroller_8 = DigitScroller(Scroller_Digits=12, Scroller_Prefix="Digit Scroller", Scroller_Radix=1, Scroller_Value=7.7777e-05)
digit_scroller_9 = DigitScroller(Scroller_Digits=12, Scroller_Prefix="Digit Scroller", Scroller_Radix=1, Scroller_Value=0.02196259374)
panel_13 = Panel(digit_scroller_9)
digit_scroller_10 = DigitScroller(Scroller_Digits=12, Scroller_Prefix="Digit Scroller", Scroller_Radix=1, Scroller_Value=7.7777e-05)
digit_scroller_11 = DigitScroller(Scroller_Digits=12, Scroller_Prefix="Digit Scroller", Scroller_Radix=1, Scroller_Value=7.5243e-06)
digit_scroller_12 = DigitScroller(Scroller_Digits=12, Scroller_Prefix="Digit Scroller", Scroller_Radix=1, Scroller_Value=7.7777e-05)
digit_scroller_13 = DigitScroller(Scroller_Digits=12, Scroller_Prefix="Digit Scroller", Scroller_Radix=1, Scroller_Value=0.02196259374)
panel_19 = Panel(digit_scroller_13)
digit_scroller_14 = DigitScroller(Scroller_Digits=12, Scroller_Prefix="Digit Scroller", Scroller_Radix=1, Scroller_Value=7.7777e-05)
digit_scroller_15 = DigitScroller(Scroller_Digits=12, Scroller_Prefix="Digit Scroller", Scroller_Radix=1, Scroller_Value=0.00274662475)
digit_scroller_16 = DigitScroller(Scroller_Digits=12, Scroller_Prefix="Digit Scroller", Scroller_Radix=1, Scroller_Value=7.7777e-05)
panel_22 = Panel("0.002746624747402")
xz_plane_2 = XZPlane(Origin=Point(0, 0, 0))
digit_scroller_17 = DigitScroller(Scroller_Digits=12, Scroller_Prefix="Digit Scroller", Scroller_Radix=1, Scroller_Value=7.5243e-06)
digit_scroller_18 = DigitScroller(Scroller_Digits=12, Scroller_Prefix="Digit Scroller", Scroller_Radix=1, Scroller_Value=7.7777e-05)
digit_scroller_19 = DigitScroller(Scroller_Digits=12, Scroller_Prefix="Digit Scroller", Scroller_Radix=1, Scroller_Value=0.02196259374)
panel_29 = Panel(digit_scroller_19)
digit_scroller_20 = DigitScroller(Scroller_Digits=12, Scroller_Prefix="Digit Scroller", Scroller_Radix=1, Scroller_Value=7.7777e-05)
digit_scroller_21 = DigitScroller(Scroller_Digits=12, Scroller_Prefix="Digit Scroller", Scroller_Radix=1, Scroller_Value=0.02196259374)
panel_35 = Panel(digit_scroller_21)
digit_scroller_22 = DigitScroller(Scroller_Digits=12, Scroller_Prefix="Digit Scroller", Scroller_Radix=1, Scroller_Value=7.7777e-05)
digit_scroller_23 = DigitScroller(Scroller_Digits=12, Scroller_Prefix="Digit Scroller", Scroller_Radix=1, Scroller_Value=7.5243e-06)
digit_scroller_24 = DigitScroller(Scroller_Digits=12, Scroller_Prefix="Digit Scroller", Scroller_Radix=1, Scroller_Value=7.7777e-05)
digit_scroller_25 = DigitScroller(Scroller_Digits=12, Scroller_Prefix="Digit Scroller", Scroller_Radix=1, Scroller_Value=7.5243e-06)
digit_scroller_26 = DigitScroller(Scroller_Digits=12, Scroller_Prefix="Digit Scroller", Scroller_Radix=1, Scroller_Value=7.7777e-05)

digit_scroller_27 = DigitScroller(Scroller_Digits=12, Scroller_Prefix=" ", Scroller_Radix=2, Scroller_Value=16)
number = Number(digit_scroller_27)

digit_scroller_28 = DigitScroller(Scroller_Digits=12, Scroller_Prefix="Digit Scroller", Scroller_Radix=1, Scroller_Value=7.5243e-06)
digit_scroller_29 = DigitScroller(Scroller_Digits=12, Scroller_Prefix="Digit Scroller", Scroller_Radix=1, Scroller_Value=7.7777e-05)
digit_scroller_30 = DigitScroller(Scroller_Digits=12, Scroller_Prefix="Digit Scroller", Scroller_Radix=1, Scroller_Value=7.5243e-06)
digit_scroller_31 = DigitScroller(Scroller_Digits=12, Scroller_Prefix="Digit Scroller", Scroller_Radix=1, Scroller_Value=7.7777e-05)
digit_scroller_32 = DigitScroller(Scroller_Digits=12, Scroller_Prefix=" ", Scroller_Radix=2, Scroller_Value=0)
digit_scroller_33 = DigitScroller(Scroller_Digits=12, Scroller_Prefix="Digit Scroller", Scroller_Radix=1, Scroller_Value=0.02196259374)
panel_47 = Panel(digit_scroller_33)
digit_scroller_34 = DigitScroller(Scroller_Digits=12, Scroller_Prefix="Digit Scroller", Scroller_Radix=1, Scroller_Value=7.7777e-05)

digit_scroller_35 = DigitScroller(Scroller_Digits=12, Scroller_Prefix=" ", Scroller_Radix=2, Scroller_Value=0)
digit_scroller_36 = DigitScroller(Scroller_Digits=12, Scroller_Prefix=" ", Scroller_Radix=2, Scroller_Value=30.9312132)
panel_48 = Panel("16.93121320041889709")
curve_2 = Curve(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)
curve_3 = Curve(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)

digit_scroller_37 = DigitScroller(Scroller_Digits=12, Scroller_Prefix="Digit Scroller", Scroller_Radix=5, Scroller_Value=20817.02838)

digit_scroller_38 = DigitScroller(Scroller_Digits=12, Scroller_Prefix="Digit Scroller", Scroller_Radix=4, Scroller_Value=2233.523438)

digit_scroller_39 = DigitScroller(Scroller_Digits=12, Scroller_Prefix="Digit Scroller", Scroller_Radix=4, Scroller_Value=281.0810667)
line_sdl = LineSDL(Start=Point(-2.121093912, 1.99985794, 0), Direction=Vector(0.0625, 0.0625, 0), Length=1)

digit_scroller_40 = DigitScroller(Scroller_Digits=12, Scroller_Prefix="Digit Scroller", Scroller_Radix=3, Scroller_Value=0.0689)
line_sdl_2 = LineSDL(Start=Point(0, 0, 0), Direction=Vector(1, 0, 0), Length=1)

digit_scroller_41 = DigitScroller(Scroller_Digits=12, Scroller_Prefix="Digit Scroller", Scroller_Radix=6, Scroller_Value=383463.9766)

digit_scroller_42 = DigitScroller(Scroller_Digits=12, Scroller_Prefix="Digit Scroller", Scroller_Radix=3, Scroller_Value=4.392015)

digit_scroller_43 = DigitScroller(Scroller_Digits=12, Scroller_Prefix="Digit Scroller", Scroller_Radix=5, Scroller_Value=56336.19681)

digit_scroller_44 = DigitScroller(Scroller_Digits=12, Scroller_Prefix="Digit Scroller", Scroller_Radix=6, Scroller_Value=271915.0063)

digit_scroller_45 = DigitScroller(Scroller_Digits=12, Scroller_Prefix="Digit Scroller", Scroller_Radix=7, Scroller_Value=2183007.899)

panel_49 = Panel("""0    256    0.0013733120705119695
0    4096    0.0000053644183496292""")
digit_scroller_46 = DigitScroller(Scroller_Digits=12, Scroller_Prefix=" ", Scroller_Radix=11, Scroller_Value=64)
digit_scroller_47 = DigitScroller(Scroller_Digits=12, Scroller_Prefix="Digit Scroller", Scroller_Radix=1, Scroller_Value=7.49e-08)
digit_scroller_48 = DigitScroller(Scroller_Digits=12, Scroller_Prefix="Digit Scroller", Scroller_Radix=1, Scroller_Value=5.243e-07)

create_material = CreateMaterial(Diffuse=RGB(191, 191, 191), Specular=RGB(0, 255, 255), Emission=RGB(0, 0, 0), Transparency=0.5, Shine=100)

create_material_2 = CreateMaterial(Diffuse=RGB(217, 217, 217), Specular=RGB(0, 255, 255), Emission=RGB(0, 0, 0), Transparency=0.5, Shine=100)

create_material_3 = CreateMaterial(Diffuse=RGB(199, 199, 199), Specular=RGB(0, 255, 255), Emission=RGB(0, 0, 0), Transparency=0.5, Shine=100)

create_material_4 = CreateMaterial(Diffuse=RGB(224, 224, 224), Specular=RGB(0, 255, 255), Emission=RGB(0, 0, 0), Transparency=0.5, Shine=100)

create_material_5 = CreateMaterial(Diffuse=RGB(207, 207, 207), Specular=RGB(0, 255, 255), Emission=RGB(0, 0, 0), Transparency=0.5, Shine=100)

create_material_6 = CreateMaterial(Diffuse=RGB(232, 232, 232), Specular=RGB(0, 255, 255), Emission=RGB(0, 0, 0), Transparency=0.5, Shine=100)

create_material_7 = CreateMaterial(Diffuse=RGB(214, 214, 214), Specular=RGB(0, 255, 255), Emission=RGB(0, 0, 0), Transparency=0.5, Shine=100)

create_material_8 = CreateMaterial(Diffuse=RGB(240, 240, 240), Specular=RGB(0, 255, 255), Emission=RGB(0, 0, 0), Transparency=0.5, Shine=100)

create_material_9 = CreateMaterial(Diffuse=RGB(222, 222, 222), Specular=RGB(0, 255, 255), Emission=RGB(0, 0, 0), Transparency=0.5, Shine=100)

create_material_10 = CreateMaterial(Diffuse=RGB(247, 247, 247), Specular=RGB(0, 255, 255), Emission=RGB(0, 0, 0), Transparency=0.5, Shine=100)

create_material_11 = CreateMaterial(Diffuse=RGB(161, 161, 161), Specular=RGB(0, 255, 255), Emission=RGB(0, 0, 0), Transparency=0.5, Shine=100)

create_material_12 = CreateMaterial(Diffuse=RGB(186, 186, 186), Specular=RGB(0, 255, 255), Emission=RGB(0, 0, 0), Transparency=0.5, Shine=100)

create_material_13 = CreateMaterial(Diffuse=RGB(168, 168, 168), Specular=RGB(0, 255, 255), Emission=RGB(0, 0, 0), Transparency=0.5, Shine=100)

create_material_14 = CreateMaterial(Diffuse=RGB(194, 194, 194), Specular=RGB(0, 255, 255), Emission=RGB(0, 0, 0), Transparency=0.5, Shine=100)

create_material_15 = CreateMaterial(Diffuse=RGB(184, 184, 184), Specular=RGB(0, 255, 255), Emission=RGB(0, 0, 0), Transparency=0.5, Shine=100)

create_material_16 = CreateMaterial(Diffuse=RGB(209, 209, 209), Specular=RGB(0, 255, 255), Emission=RGB(0, 0, 0), Transparency=0.5, Shine=100)

create_material_17 = CreateMaterial(Diffuse=RGB(176, 176, 176), Specular=RGB(0, 255, 255), Emission=RGB(0, 0, 0), Transparency=0.5, Shine=100)

create_material_18 = CreateMaterial(Diffuse=RGB(201, 201, 201), Specular=RGB(0, 255, 255), Emission=RGB(0, 0, 0), Transparency=0.5, Shine=100)

digit_scroller_49 = DigitScroller(Scroller_Digits=12, Scroller_Prefix=" ", Scroller_Radix=7, Scroller_Value=16)

panel_50 = Panel("0.35721403168191375/4/4")
panel_51 = Panel("""1    16    0.35721403168191375
1    256    0.0014014999884235925
1    4096    """)
digit_scroller_50 = DigitScroller(Scroller_Digits=12, Scroller_Prefix="Digit Scroller", Scroller_Radix=1, Scroller_Value=0.00140149998)
radians = Radians(Degrees="0.001373312102167")
number_slider = Slider(256, range=0..65536)

panel_52 = Panel("0.0013733120705119695*4*4")

expression = Expression(O=radians, Expression="FORMAT(\"{0:0.00000000000000000000}\",O)")
panel_53 = Panel(expression)
curve_4 = Curve(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)

digit_scroller_51 = DigitScroller(Scroller_Digits=12, Scroller_Prefix=" ", Scroller_Radix=7, Scroller_Value=16)

vector_xyz = VectorXYZ(XComponent=0, YComponent=4, ZComponent=0)  # -> Vector, Length

number_slider_2 = Slider(1, range=0..1)

digit_scroller_52 = DigitScroller(Scroller_Digits=12, Scroller_Prefix=" ", Scroller_Radix=2, Scroller_Value=0)
panel_54 = Panel("30.93121320041889709")
curve_5 = Curve(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)
curve_6 = Curve(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)

digit_scroller_53 = DigitScroller(Scroller_Digits=12, Scroller_Prefix=" ", Scroller_Radix=2, Scroller_Value=0)
digit_scroller_54 = DigitScroller(Scroller_Digits=12, Scroller_Prefix=" ", Scroller_Radix=2, Scroller_Value=30.9312132)
curve_7 = Curve(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)
curve_8 = Curve(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)

digit_scroller_55 = DigitScroller(Scroller_Digits=12, Scroller_Prefix="Digit Scroller", Scroller_Radix=1, Scroller_Value=0.00140149998)
number_slider_3 = Slider(256, range=0..65536)

digit_scroller_56 = DigitScroller(Scroller_Digits=12, Scroller_Prefix=" ", Scroller_Radix=4, Scroller_Value=1179.13)

digit_scroller_57 = DigitScroller(Scroller_Digits=12, Scroller_Prefix=" ", Scroller_Radix=1, Scroller_Value=0.09375)

digit_scroller_58 = DigitScroller(Scroller_Digits=12, Scroller_Prefix=" ", Scroller_Radix=6, Scroller_Value=0.75)

digit_scroller_59 = DigitScroller(Scroller_Digits=12, Scroller_Prefix=" ", Scroller_Radix=11, Scroller_Value=256)
digit_scroller_60 = DigitScroller(Scroller_Digits=12, Scroller_Prefix=" ", Scroller_Radix=11, Scroller_Value=87)
create_material_19 = CreateMaterial(Diffuse=RGB(222, 222, 222), Specular=RGB(0, 255, 255), Emission=RGB(0, 0, 0), Transparency=0.5, Shine=100)
create_material_20 = CreateMaterial(Diffuse=RGB(247, 247, 247), Specular=RGB(0, 255, 255), Emission=RGB(0, 0, 0), Transparency=0.5, Shine=100)
create_material_21 = CreateMaterial(Diffuse=RGB(176, 176, 176), Specular=RGB(0, 255, 255), Emission=RGB(0, 0, 0), Transparency=0.5, Shine=100)

digit_scroller_61 = DigitScroller(Scroller_Digits=12, Scroller_Prefix=" ", Scroller_Radix=2, Scroller_Value=0.024609375)

digit_scroller_62 = DigitScroller(Scroller_Digits=12, Scroller_Prefix=" ", Scroller_Radix=1, Scroller_Value=0.0703125)

digit_scroller_63 = DigitScroller(Scroller_Digits=12, Scroller_Prefix="Digit Scroller", Scroller_Radix=1, Scroller_Value=0.00140149998)
radians_2 = Radians(Degrees="0.001373312102167")
number_slider_4 = Slider(256, range=0..65536)

create_material_22 = CreateMaterial(Diffuse=RGB(207, 207, 207), Specular=RGB(0, 255, 255), Emission=RGB(0, 0, 0), Transparency=0.5, Shine=100)
create_material_23 = CreateMaterial(Diffuse=RGB(232, 232, 232), Specular=RGB(0, 255, 255), Emission=RGB(0, 0, 0), Transparency=0.5, Shine=100)
create_material_24 = CreateMaterial(Diffuse=RGB(214, 214, 214), Specular=RGB(0, 255, 255), Emission=RGB(0, 0, 0), Transparency=0.5, Shine=100)
create_material_25 = CreateMaterial(Diffuse=RGB(240, 240, 240), Specular=RGB(0, 255, 255), Emission=RGB(0, 0, 0), Transparency=0.5, Shine=100)

create_material_26 = CreateMaterial(Diffuse=RGB(161, 161, 161), Specular=RGB(0, 255, 255), Emission=RGB(0, 0, 0), Transparency=0.5, Shine=100)
create_material_27 = CreateMaterial(Diffuse=RGB(186, 186, 186), Specular=RGB(0, 255, 255), Emission=RGB(0, 0, 0), Transparency=0.5, Shine=100)

create_material_28 = CreateMaterial(Diffuse=RGB(168, 168, 168), Specular=RGB(0, 255, 255), Emission=RGB(0, 0, 0), Transparency=0.5, Shine=100)
create_material_29 = CreateMaterial(Diffuse=RGB(194, 194, 194), Specular=RGB(0, 255, 255), Emission=RGB(0, 0, 0), Transparency=0.5, Shine=100)

create_material_30 = CreateMaterial(Diffuse=RGB(176, 176, 176), Specular=RGB(0, 255, 255), Emission=RGB(0, 0, 0), Transparency=0.5, Shine=100)
create_material_31 = CreateMaterial(Diffuse=RGB(201, 201, 201), Specular=RGB(0, 255, 255), Emission=RGB(0, 0, 0), Transparency=0.5, Shine=100)

expression_2 = Expression(O=radians_2, Expression="FORMAT(\"{0:0.00000000000000000000}\",O)")
panel_61 = Panel(expression_2)
curve_9 = Curve(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)

create_material_32 = CreateMaterial(Diffuse=RGB(184, 184, 184), Specular=RGB(0, 255, 255), Emission=RGB(0, 0, 0), Transparency=0.5, Shine=100)
create_material_33 = CreateMaterial(Diffuse=RGB(209, 209, 209), Specular=RGB(0, 255, 255), Emission=RGB(0, 0, 0), Transparency=0.5, Shine=100)

create_material_34 = CreateMaterial(Diffuse=RGB(191, 191, 191), Specular=RGB(0, 255, 255), Emission=RGB(0, 0, 0), Transparency=0.5, Shine=100)
create_material_35 = CreateMaterial(Diffuse=RGB(217, 217, 217), Specular=RGB(0, 255, 255), Emission=RGB(0, 0, 0), Transparency=0.5, Shine=100)

create_material_36 = CreateMaterial(Diffuse=RGB(199, 199, 199), Specular=RGB(0, 255, 255), Emission=RGB(0, 0, 0), Transparency=0.5, Shine=100)
create_material_37 = CreateMaterial(Diffuse=RGB(224, 224, 224), Specular=RGB(0, 255, 255), Emission=RGB(0, 0, 0), Transparency=0.5, Shine=100)

create_material_38 = CreateMaterial(Diffuse=RGB(207, 207, 207), Specular=RGB(0, 255, 255), Emission=RGB(0, 0, 0), Transparency=0.5, Shine=100)
create_material_39 = CreateMaterial(Diffuse=RGB(232, 232, 232), Specular=RGB(0, 255, 255), Emission=RGB(0, 0, 0), Transparency=0.5, Shine=100)

digit_scroller_64 = DigitScroller(Scroller_Digits=12, Scroller_Prefix=" ", Scroller_Radix=7, Scroller_Value=16)

number_slider_5 = Slider(1, range=0..1)

curve_10 = Curve(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)

digit_scroller_65 = DigitScroller(Scroller_Digits=12, Scroller_Prefix=" ", Scroller_Radix=7, Scroller_Value=16)

vector_xyz_2 = VectorXYZ(XComponent=2.5, YComponent=4, ZComponent=0)  # -> Vector, Length

number_slider_6 = Slider(1, range=0..1)

digit_scroller_66 = DigitScroller(Scroller_Digits=12, Scroller_Prefix=" ", Scroller_Radix=2, Scroller_Value=0)
curve_11 = Curve(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)
curve_12 = Curve(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)

digit_scroller_67 = DigitScroller(Scroller_Digits=12, Scroller_Prefix=" ", Scroller_Radix=2, Scroller_Value=0)
digit_scroller_68 = DigitScroller(Scroller_Digits=12, Scroller_Prefix=" ", Scroller_Radix=2, Scroller_Value=30.9312132)
curve_13 = Curve(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)
curve_14 = Curve(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)

digit_scroller_69 = DigitScroller(Scroller_Digits=12, Scroller_Prefix="Digit Scroller", Scroller_Radix=1, Scroller_Value=0.00140149998)
number_slider_7 = Slider(256, range=0..65536)

digit_scroller_70 = DigitScroller(Scroller_Digits=12, Scroller_Prefix="Digit Scroller", Scroller_Radix=1, Scroller_Value=0.00140149998)
radians_3 = Radians(Degrees="0.001373312102167")
number_slider_8 = Slider(256, range=0..65536)

expression_3 = Expression(O=radians_3, Expression="FORMAT(\"{0:0.00000000000000000000}\",O)")
panel_69 = Panel(expression_3)
curve_15 = Curve(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)

digit_scroller_71 = DigitScroller(Scroller_Digits=12, Scroller_Prefix=" ", Scroller_Radix=7, Scroller_Value=16)

digit_scroller_72 = DigitScroller(Scroller_Digits=12, Scroller_Prefix=" ", Scroller_Radix=7, Scroller_Value=16)

number_slider_9 = Slider(1, range=0..1)

vector_xyz_3 = VectorXYZ(XComponent=5, YComponent=4, ZComponent=0)  # -> Vector, Length

number_slider_10 = Slider(1, range=0..1)

curve_16 = Curve(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)

vector_xyz_4 = VectorXYZ(XComponent=5, YComponent=1.5, ZComponent=0)  # -> Vector, Length

digit_scroller_73 = DigitScroller(Scroller_Digits=12, Scroller_Prefix=" ", Scroller_Radix=2, Scroller_Value=30.9312132)
digit_scroller_74 = DigitScroller(Scroller_Digits=12, Scroller_Prefix=" ", Scroller_Radix=2, Scroller_Value=0)
curve_17 = Curve(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)
curve_18 = Curve(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)

digit_scroller_75 = DigitScroller(Scroller_Digits=12, Scroller_Prefix="Digit Scroller", Scroller_Radix=1, Scroller_Value=0.00140149998)
radians_4 = Radians(Degrees="0.002746624747402")
number_slider_11 = Slider(256, range=0..65536)

expression_4 = Expression(O=radians_4, Expression="FORMAT(\"{0:0.00000000000000000000}\",O)")
panel_73 = Panel(expression_4)
curve_19 = Curve(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)

digit_scroller_76 = DigitScroller(Scroller_Digits=12, Scroller_Prefix=" ", Scroller_Radix=7, Scroller_Value=16)

digit_scroller_77 = DigitScroller(Scroller_Digits=12, Scroller_Prefix=" ", Scroller_Radix=2, Scroller_Value=0)
curve_20 = Curve(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)
curve_21 = Curve(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)

vector_xyz_5 = VectorXYZ(XComponent=10, YComponent=4, ZComponent=0)  # -> Vector, Length

digit_scroller_78 = DigitScroller(Scroller_Digits=12, Scroller_Prefix=" ", Scroller_Radix=2, Scroller_Value=0)
digit_scroller_79 = DigitScroller(Scroller_Digits=12, Scroller_Prefix=" ", Scroller_Radix=2, Scroller_Value=30.9312132)
curve_22 = Curve(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)
curve_23 = Curve(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)

number_slider_12 = Slider(1, range=0..1)

digit_scroller_80 = DigitScroller(Scroller_Digits=12, Scroller_Prefix="Digit Scroller", Scroller_Radix=1, Scroller_Value=0.00140149998)
number_slider_13 = Slider(256, range=0..65536)

digit_scroller_81 = DigitScroller(Scroller_Digits=12, Scroller_Prefix="Digit Scroller", Scroller_Radix=1, Scroller_Value=0.00140149998)
radians_5 = Radians(Degrees="0.001373312102167")
number_slider_14 = Slider(256, range=0..65536)

expression_5 = Expression(O=radians_5, Expression="FORMAT(\"{0:0.00000000000000000000}\",O)")
panel_81 = Panel(expression_5)
curve_24 = Curve(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)

digit_scroller_82 = DigitScroller(Scroller_Digits=12, Scroller_Prefix=" ", Scroller_Radix=7, Scroller_Value=16)

number_slider_15 = Slider(1, range=0..1)

digit_scroller_83 = DigitScroller(Scroller_Digits=12, Scroller_Prefix=" ", Scroller_Radix=7, Scroller_Value=16)

vector_xyz_6 = VectorXYZ(XComponent=7.5, YComponent=4, ZComponent=0)  # -> Vector, Length

curve_25 = Curve(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)

number_slider_16 = Slider(1, range=0..1)

digit_scroller_84 = DigitScroller(Scroller_Digits=12, Scroller_Prefix="Digit Scroller", Scroller_Radix=11, Scroller_Value=16.4)
construct_point = ConstructPoint(XCoordinate=0.5, YCoordinate=0.5, ZCoordinate=0)  # -> flatten(Point)
line_sdl_3 = LineSDL(Start=Point(0, 0, 0), Direction=Vector(1, 0, 0), Length=expr("X", 1))
file_path = FilePath("C:\IICSA.O__4201_EDIWID_1_TNEMERCNI__3_TNEIDARG_PUKOOL_ROLOC_HTOMS_3_DIOMGIS_ERUTAWRUC_RAENIL_DEPAM_4_NOITISNART_EGDE_LUF_EKUN__O__NUKE_FUL_EDGE_TRANSITION_4_MAPED_LINEAR_CURWATURE_SIGMOID_3_SMOTH_COLOR_LOOKUP_GRADIENT_3__INCREMENT_1_DIWIDE_1024__O.ASCII")
number_2 = Number(digit_scroller_84)

vector_xyz_7 = VectorXYZ(XComponent=7.5, YComponent=1.5, ZComponent=0)  # -> Vector, Length

button = Button()  # disabled
file_path_2 = FilePath("C:\VSC.O____STNEMGES_4201____HTOMS_LEVEL_3_DIOMGIS_ERUTAWRUC_RAENIL_DEPAM_SEMIT_4_NOITISNART_EGDE_LUF____O____FUL_EDGE_TRANSITION_4_TIMES_MAPED_LINEAR_CURWATURE_SIGMOID_3_LEVEL_SMOTH____1024_SEGMENTS____O.CSV")  # disabled

digit_scroller_85 = DigitScroller(Scroller_Digits=12, Scroller_Prefix=" ", Scroller_Radix=2, Scroller_Value=30.9312132)
digit_scroller_86 = DigitScroller(Scroller_Digits=12, Scroller_Prefix=" ", Scroller_Radix=2, Scroller_Value=0)
curve_26 = Curve(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)
curve_27 = Curve(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)

digit_scroller_87 = DigitScroller(Scroller_Digits=12, Scroller_Prefix=" ", Scroller_Radix=2, Scroller_Value=0)
curve_28 = Curve(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)
curve_29 = Curve(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)

digit_scroller_88 = DigitScroller(Scroller_Digits=12, Scroller_Prefix="Digit Scroller", Scroller_Radix=1, Scroller_Value=0.00140149998)
radians_6 = Radians(Degrees="0.001373312102167")
number_slider_17 = Slider(256, range=0..65536)

digit_scroller_89 = DigitScroller(Scroller_Digits=12, Scroller_Prefix="Digit Scroller", Scroller_Radix=1, Scroller_Value=0.00140149998)
number_slider_18 = Slider(256, range=0..65536)

expression_6 = Expression(O=radians_6, Expression="FORMAT(\"{0:0.00000000000000000000}\",O)")
panel_89 = Panel(expression_6)
curve_30 = Curve(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)

digit_scroller_90 = DigitScroller(Scroller_Digits=12, Scroller_Prefix=" ", Scroller_Radix=7, Scroller_Value=16)

vector_xyz_8 = VectorXYZ(XComponent=10, YComponent=4, ZComponent=0)  # -> Vector, Length

digit_scroller_91 = DigitScroller(Scroller_Digits=12, Scroller_Prefix=" ", Scroller_Radix=7, Scroller_Value=16)

number_slider_19 = Slider(1, range=0..1)

number_slider_20 = Slider(1, range=0..1)

curve_31 = Curve(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)

number_slider_21 = Slider(0, range=0..1)  # disabled
button_2 = Button()  # disabled
file_path_3 = FilePath("C:\VSC.O____EPAHS_LANGIS____STNEMGES_4201____HTOMS_LEVEL_3_DIOMGIS_ERUTAWRUC_RAENIL_DEPAM_SEMIT_4_NOITISNART_EGDE_LUF____O____FUL_EDGE_TRANSITION_4_TIMES_MAPED_LINEAR_CURWATURE_SIGMOID_3_LEVEL_SMOTH____1024_SEGMENTS____SIGNAL_SHAPE____O.CSV")  # disabled

vector_xyz_9 = VectorXYZ(XComponent=10, YComponent=1.5, ZComponent=0)  # -> Vector, Length

digit_scroller_92 = DigitScroller(Scroller_Digits=12, Scroller_Prefix=" ", Scroller_Radix=2, Scroller_Value=0)
curve_32 = Curve(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)
curve_33 = Curve(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)

digit_scroller_93 = DigitScroller(Scroller_Digits=12, Scroller_Prefix="Digit Scroller", Scroller_Radix=1, Scroller_Value=0.00140149998)
number_slider_22 = Slider(256, range=0..65536)

digit_scroller_94 = DigitScroller(Scroller_Digits=12, Scroller_Prefix=" ", Scroller_Radix=7, Scroller_Value=16)

number_slider_23 = Slider(1, range=0..1)

curve_34 = Curve(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)

vector_xyz_10 = VectorXYZ(XComponent=12.5, YComponent=1.5, ZComponent=0)  # -> Vector, Length

digit_scroller_95 = DigitScroller(Scroller_Digits=12, Scroller_Prefix=" ", Scroller_Radix=1, Scroller_Value=3.243e-07)
digit_scroller_96 = DigitScroller(Scroller_Digits=12, Scroller_Prefix=" ", Scroller_Radix=11, Scroller_Value=256)
number_slider_24 = Slider(1, range=0..1)
number_slider_25 = Slider(1, range=0..1)
number_3 = Number(digit_scroller_95)

number_4 = Number(digit_scroller_96)

radians_7 = Radians(Degrees=number_3)

number_5 = Number(digit_scroller_96)

number_6 = Number(number_5)
number_7 = Number(number_5)
number_8 = Number(expr("X*4", number_7))

number_9 = Number(number_8)

divide_curve = DivideCurve(Curve=line_sdl_2, Count=number_9, Kinks=False)  # -> Points, Tangents, Parameters

series = Series(Start=0, Step=radians_7, Count=number_5)
expression_7 = Expression(X=number_5, Expression="1/X")
duplicate_data = DuplicateData(Data=expression_7, Number=number_5, Order=True)
turtle = DotNETVBScriptLEGACY(Forward=duplicate_data, Left=series)  # -> Output, Points; inputs Forward: list, Left: list
# ---------- turtle: VB ----------
    Dim i As Integer
    Dim dir As New On3dVector(1, 0, 0)    
    Dim pos As New On3dVector(0, 0, 0) 
    Dim axis As New On3dVector(0, 0, 1)
    Dim pnts As New List(Of On3dVector)

    pnts.Add(pos)
    
    For i = 0 To Forward.Count() - 1
      Dim P As New On3dVector
      dir.Rotate(Left(i), axis)      
      P = dir * Forward(i) + pnts(i)
      pnts.Add(P)
    Next
    
    Points = pnts
# ---------- end turtle ----------
point_2 = Point(turtle.Points)

scale = Scale(Geometry=point_2, Center=Point(0, 0, 0), Factor=expr("2^X", digit_scroller_49))  # -> Geometry, Transform

interpolate_t = InterpolateT(Vertices=scale.Geometry, TangentStart=Vector(0.0625, 0, 0), TangentEnd=Vector(0, 0, 0), KnotStyle=2)  # -> Curve, Length, Domain
evaluate_length = EvaluateLength(Curve=interpolate_t.Curve, Length=1, Normalized=True)  # -> Point, Tangent, Parameter
line_sdl_4 = LineSDL(Start=evaluate_length.Point, Direction=evaluate_length.Tangent, Length=1)
mirror = Mirror(Geometry=interpolate_t.Curve, Plane=line_sdl_4)  # -> Geometry, Transform
join_curves = JoinCurves(Curves=[interpolate_t.Curve, mirror.Geometry], Preserve=False)
evaluate_length_2 = EvaluateLength(Curve=join_curves, Length=1, Normalized=True)  # -> Point, Tangent, Parameter
rotate = Rotate(Geometry=join_curves, Angle=3.141592654, Plane=evaluate_length_2.Point)  # -> Geometry, Transform
join_curves_2 = JoinCurves(Curves=[join_curves, rotate.Geometry], Preserve=False)
curve_35 = Curve(join_curves_2)

expression_8 = Expression(O=turtle.Points, Expression="FORMAT(\"{0:R}\",O)")
expression_9 = Expression(O=series, Expression="FORMAT(\"{0:R}\",O)")
panel_94 = Panel(expression_9)
evaluate_length_3 = EvaluateLength(Curve=join_curves_2, Length=1, Normalized=True)  # -> Point, Tangent, Parameter
deconstruct = Deconstruct(Point=evaluate_length_3.Point)  # -> XComponent, YComponent, ZComponent
expression_10 = Expression(O=deconstruct.YComponent, Expression="FORMAT(\"{0:R}\",O)")
expression_11 = Expression(O=deconstruct.XComponent, Expression="FORMAT(\"{0:R}\",O)")
expression_12 = Expression(O=deconstruct.ZComponent, Expression="FORMAT(\"{0:R}\",O)")
panel_95 = Panel(expression_10)
panel_96 = Panel(expression_11)
panel_97 = Panel(expression_12)
addition = Addition(A=panel_95, B=panel_96)
expression_13 = Expression(O=addition, Expression="FORMAT(\"{0:R}\",O)")
panel_98 = Panel(expression_13)
division = Division(A=panel_98, B=2)
expression_14 = Expression(O=division, Expression="FORMAT(\"{0:R}\",O)")
panel_99 = Panel(expression_14)
scale_2 = Scale(Geometry=curve_35, Center=Point(0, 0, 0), Factor=expr("1/X", panel_99))  # -> Geometry, Transform
evaluate_length_4 = EvaluateLength(Curve=scale_2.Geometry, Length=1, Normalized=True)  # -> Point, Tangent, Parameter
deconstruct_2 = Deconstruct(Point=evaluate_length_4.Point)  # -> XComponent, YComponent, ZComponent
expression_15 = Expression(O=deconstruct_2.XComponent, Expression="FORMAT(\"{0:R}\",O)")
expression_16 = Expression(O=deconstruct_2.ZComponent, Expression="FORMAT(\"{0:R}\",O)")
expression_17 = Expression(O=deconstruct_2.YComponent, Expression="FORMAT(\"{0:R}\",O)")
panel_100 = Panel(expression_16)
panel_101 = Panel(expression_17)
panel_102 = Panel(expression_15)
division_2 = Division(A=panel_96, B=panel_95)
expression_18 = Expression(O=division_2, Expression="FORMAT(\"{0:R}\",O)")
panel_103 = Panel(expression_18)
curve_36 = Curve(scale_2.Geometry)

panel_105 = Panel(expression_8)

move = Move(Geometry=curve_36, Motion=Vector(0, 0, 0))  # -> Geometry, Transform
curve_37 = Curve(move.Geometry)  # disabled

curve_38 = Curve(curve_36)
end_points = EndPoints(Curve=curve_38)  # -> Start, End
rectangle_2pt = Rectangle2Pt(Plane=PlaneXY(0, 0, 0), PointA=end_points.Start, PointB=end_points.End, Radius=0)  # -> Rectangle, Length
deconstuct_rectangle = DeconstuctRectangle(Rectangle=rectangle_2pt.Rectangle)  # -> BasePlane, XInterval, YInterval
deconstruct_domain = DeconstructDomain(Domain=deconstuct_rectangle.YInterval)  # -> Start, End
deconstruct_domain_2 = DeconstructDomain(Domain=deconstuct_rectangle.XInterval)  # -> Start, End
scale_nu = ScaleNU(
    Geometry=curve_36,
    Plane=PlaneXY(0, 0, 0),
    ScaleX=expr("1/X", deconstruct_domain_2.End),
    ScaleY=expr("1/X", deconstruct_domain.End),
    ScaleZ=1)  # -> Geometry, Transform
curve_39 = Curve(scale_nu.Geometry)

stream_filter = StreamFilter(Gate=number_slider_24, Stream0=curve_36, Stream1=curve_39)
curve_40 = Curve(stream_filter)
scale_3 = Scale(Geometry=curve_40, Center=Point(0, 0, 0), Factor=expr("2^X", number))  # -> Geometry, Transform
curve_41 = Curve(scale_3.Geometry)

move_2 = Move(Geometry=curve_39, Motion=Vector(0, 1.5, 0))  # -> Geometry, Transform
curve_42 = Curve(move_2.Geometry)  # disabled

stream_filter_2 = StreamFilter(Gate=number_slider_24, Stream0=curve_36, Stream1=curve_39)
curve_43 = Curve(stream_filter_2)
scale_4 = Scale(Geometry=curve_43, Center=Point(0, 0, 0), Factor=expr("2^X", number))  # -> Geometry, Transform
curve_44 = Curve(scale_4.Geometry)

end_points_2 = EndPoints(Curve=curve_41)  # -> Start, End
rectangle_2pt_2 = Rectangle2Pt(Plane=PlaneXY(0, 0, 0), PointA=end_points_2.Start, PointB=end_points_2.End, Radius=0)  # -> Rectangle, Length

number_10 = Number(number_5)

series_2 = Series(Start=0, Step=panel_53, Count=number_10)
expression_19 = Expression(O=series_2, Expression="FORMAT(\"{0:R}\",O)")  # disabled
panel_106 = Panel(expression_19)
bounds = Bounds(Numbers=series_2)
expression_20 = Expression(X=number_10, Expression="1/X")
duplicate_data_2 = DuplicateData(Data=expression_20, Number=number_10, Order=True)

curve_graph_mapper = CurveGraphMapper(Curves=curve_41, Rectangle=rectangle_2pt_2.Rectangle, Values=series_2, Flip=False, Snap=True, TextSize=0.015625)  # -> Mapped, GraphCurves, GraphPoints, ValueLines, ValuePoints, MappedLines, MappedPoints, Boundary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; disabled
graphmapper = GraphMapper(Curve=curve_41, Boundary=rectangle_2pt_2.Rectangle, Numbers=series_2, Input=bounds, Output=bounds, bobo=False)  # disabled
stream_filter_3 = StreamFilter(Gate=number_slider_25, Stream0=curve_graph_mapper.Mapped, Stream1=graphmapper)

turtle_2 = DotNETVBScriptLEGACY(Forward=duplicate_data_2, Left=stream_filter_3)  # -> Output, Points; inputs Forward: list, Left: list; same code as turtle

expression_21 = Expression(O=turtle_2.Points, Expression="FORMAT(\"{0:R}\",O)")
panel_107 = Panel(expression_21)

point_3 = Point(turtle_2.Points)
scale_5 = Scale(Geometry=point_3, Center=Point(0, 0, 0), Factor=expr("2^X", digit_scroller_51))  # -> Geometry, Transform

interpolate_t_2 = InterpolateT(Vertices=scale_5.Geometry, TangentStart=Vector(0.0625, 0, 0), TangentEnd=Vector(0, 0, 0), KnotStyle=2)  # -> Curve, Length, Domain
evaluate_length_5 = EvaluateLength(Curve=interpolate_t_2.Curve, Length=1, Normalized=True)  # -> Point, Tangent, Parameter
line_sdl_5 = LineSDL(Start=evaluate_length_5.Point, Direction=evaluate_length_5.Tangent, Length=1)
mirror_2 = Mirror(Geometry=interpolate_t_2.Curve, Plane=line_sdl_5)  # -> Geometry, Transform
join_curves_3 = JoinCurves(Curves=[interpolate_t_2.Curve, mirror_2.Geometry], Preserve=False)
evaluate_length_6 = EvaluateLength(Curve=join_curves_3, Length=1, Normalized=True)  # -> Point, Tangent, Parameter
rotate_2 = Rotate(Geometry=join_curves_3, Angle=3.141592654, Plane=evaluate_length_6.Point)  # -> Geometry, Transform
join_curves_4 = JoinCurves(Curves=[join_curves_3, rotate_2.Geometry], Preserve=False)
curve_45 = Curve(join_curves_4)

evaluate_length_7 = EvaluateLength(Curve=join_curves_4, Length=1, Normalized=True)  # -> Point, Tangent, Parameter
deconstruct_3 = Deconstruct(Point=evaluate_length_7.Point)  # -> XComponent, YComponent, ZComponent
expression_22 = Expression(O=deconstruct_3.YComponent, Expression="FORMAT(\"{0:R}\",O)")
expression_23 = Expression(O=deconstruct_3.XComponent, Expression="FORMAT(\"{0:R}\",O)")
expression_24 = Expression(O=deconstruct_3.ZComponent, Expression="FORMAT(\"{0:R}\",O)")
panel_108 = Panel(expression_22)
panel_109 = Panel(expression_23)
panel_110 = Panel(expression_24)
addition_2 = Addition(A=panel_108, B=panel_109)
expression_25 = Expression(O=addition_2, Expression="FORMAT(\"{0:R}\",O)")
panel_111 = Panel(expression_25)
division_3 = Division(A=panel_111, B=2)
expression_26 = Expression(O=division_3, Expression="FORMAT(\"{0:R}\",O)")
panel_112 = Panel(expression_26)
scale_6 = Scale(Geometry=scale_5.Geometry, Center=Point(0, 0, 0), Factor=expr("1/X", panel_112))  # -> Geometry, Transform
scale_7 = Scale(Geometry=curve_45, Center=Point(0, 0, 0), Factor=expr("1/X", panel_112))  # -> Geometry, Transform
evaluate_length_8 = EvaluateLength(Curve=scale_7.Geometry, Length=1, Normalized=True)  # -> Point, Tangent, Parameter
deconstruct_4 = Deconstruct(Point=evaluate_length_8.Point)  # -> XComponent, YComponent, ZComponent
expression_27 = Expression(O=deconstruct_4.YComponent, Expression="FORMAT(\"{0:R}\",O)")
expression_28 = Expression(O=deconstruct_4.XComponent, Expression="FORMAT(\"{0:R}\",O)")
expression_29 = Expression(O=deconstruct_4.ZComponent, Expression="FORMAT(\"{0:R}\",O)")
panel_113 = Panel(expression_27)
panel_114 = Panel(expression_28)
panel_115 = Panel(expression_29)
division_4 = Division(A=panel_109, B=panel_108)
expression_30 = Expression(O=division_4, Expression="FORMAT(\"{0:R}\",O)")
panel_116 = Panel(expression_30)
curve_46 = Curve(scale_7.Geometry)
point_4 = Point(scale_6.Geometry)

move_3 = Move(Geometry=curve_46, Motion=vector_xyz.Vector)  # -> Geometry, Transform
mirror_3 = Mirror(Geometry=curve_46, Plane=PlaneYZ(0, 0, 0))  # -> Geometry, Transform; disabled
curve_47 = Curve(move_3.Geometry)

radians_8 = Radians(Degrees=number_3)

expression_31 = Expression(O=radians_8, Expression="FORMAT(\"{0:0.00000000000000000000}\",O)")
panel_118 = Panel(expression_31)
number_11 = Number(number_5)

number_12 = Number(number_8)
number_13 = Number(number_12)

end_points_3 = EndPoints(Curve=curve_44)  # -> Start, End
rectangle_2pt_3 = Rectangle2Pt(Plane=PlaneXY(0, 0, 0), PointA=end_points_3.Start, PointB=end_points_3.End, Radius=0)  # -> Rectangle, Length

series_3 = Series(Start=0, Step=panel_118, Count=number_11)
expression_32 = Expression(O=series_3, Expression="FORMAT(\"{0:R}\",O)")  # disabled
panel_119 = Panel(expression_32)
bounds_2 = Bounds(Numbers=series_3)
expression_33 = Expression(X=number_11, Expression="1/X")
duplicate_data_3 = DuplicateData(Data=expression_33, Number=number_11, Order=True)

curve_graph_mapper_2 = CurveGraphMapper(Curves=curve_44, Rectangle=rectangle_2pt_3.Rectangle, Values=series_3, Flip=False, Snap=True, TextSize=0.015625)  # -> Mapped, GraphCurves, GraphPoints, ValueLines, ValuePoints, MappedLines, MappedPoints, Boundary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; disabled
graphmapper_2 = GraphMapper(Curve=curve_44, Boundary=rectangle_2pt_3.Rectangle, Numbers=series_3, Input=bounds_2, Output=bounds_2, bobo=True)
stream_filter_4 = StreamFilter(Gate=number_slider_25, Stream0=curve_graph_mapper_2.Mapped, Stream1=graphmapper_2)

turtle_3 = DotNETVBScriptLEGACY(Forward=duplicate_data_3, Left=stream_filter_4)  # -> Output, Points; inputs Forward: list, Left: list; same code as turtle

expression_34 = Expression(O=turtle_3.Points, Expression="FORMAT(\"{0:R}\",O)")
panel_120 = Panel(expression_34)

point_5 = Point(turtle_3.Points)
scale_8 = Scale(Geometry=point_5, Center=Point(0, 0, 0), Factor=expr("2^X", digit_scroller_64))  # -> Geometry, Transform

interpolate_t_3 = InterpolateT(Vertices=scale_8.Geometry, TangentStart=Vector(0.0625, 0, 0), TangentEnd=Vector(0, 0, 0), KnotStyle=2)  # -> Curve, Length, Domain
evaluate_length_9 = EvaluateLength(Curve=interpolate_t_3.Curve, Length=1, Normalized=True)  # -> Point, Tangent, Parameter
line_sdl_6 = LineSDL(Start=evaluate_length_9.Point, Direction=evaluate_length_9.Tangent, Length=1)
mirror_4 = Mirror(Geometry=interpolate_t_3.Curve, Plane=line_sdl_6)  # -> Geometry, Transform
join_curves_5 = JoinCurves(Curves=[interpolate_t_3.Curve, mirror_4.Geometry], Preserve=False)
evaluate_length_10 = EvaluateLength(Curve=join_curves_5, Length=1, Normalized=True)  # -> Point, Tangent, Parameter
rotate_3 = Rotate(Geometry=join_curves_5, Angle=3.141592654, Plane=evaluate_length_10.Point)  # -> Geometry, Transform
join_curves_6 = JoinCurves(Curves=[join_curves_5, rotate_3.Geometry], Preserve=False)
curve_48 = Curve(join_curves_6)

evaluate_length_11 = EvaluateLength(Curve=join_curves_6, Length=1, Normalized=True)  # -> Point, Tangent, Parameter
deconstruct_5 = Deconstruct(Point=evaluate_length_11.Point)  # -> XComponent, YComponent, ZComponent
expression_35 = Expression(O=deconstruct_5.YComponent, Expression="FORMAT(\"{0:R}\",O)")
expression_36 = Expression(O=deconstruct_5.XComponent, Expression="FORMAT(\"{0:R}\",O)")
expression_37 = Expression(O=deconstruct_5.ZComponent, Expression="FORMAT(\"{0:R}\",O)")
panel_121 = Panel(expression_35)
panel_122 = Panel(expression_36)
panel_123 = Panel(expression_37)
addition_3 = Addition(A=panel_121, B=panel_122)
expression_38 = Expression(O=addition_3, Expression="FORMAT(\"{0:R}\",O)")
panel_124 = Panel(expression_38)
division_5 = Division(A=panel_124, B=2)
expression_39 = Expression(O=division_5, Expression="FORMAT(\"{0:R}\",O)")
panel_125 = Panel(expression_39)
scale_9 = Scale(Geometry=scale_8.Geometry, Center=Point(0, 0, 0), Factor=expr("1/X", panel_125))  # -> Geometry, Transform
scale_10 = Scale(Geometry=curve_48, Center=Point(0, 0, 0), Factor=expr("1/X", panel_125))  # -> Geometry, Transform
evaluate_length_12 = EvaluateLength(Curve=scale_10.Geometry, Length=1, Normalized=True)  # -> Point, Tangent, Parameter
deconstruct_6 = Deconstruct(Point=evaluate_length_12.Point)  # -> XComponent, YComponent, ZComponent
expression_40 = Expression(O=deconstruct_6.YComponent, Expression="FORMAT(\"{0:R}\",O)")
expression_41 = Expression(O=deconstruct_6.XComponent, Expression="FORMAT(\"{0:R}\",O)")
expression_42 = Expression(O=deconstruct_6.ZComponent, Expression="FORMAT(\"{0:R}\",O)")
panel_126 = Panel(expression_40)
panel_127 = Panel(expression_41)
panel_128 = Panel(expression_42)
division_6 = Division(A=panel_122, B=panel_121)
expression_43 = Expression(O=division_6, Expression="FORMAT(\"{0:R}\",O)")
panel_129 = Panel(expression_43)
curve_49 = Curve(scale_10.Geometry)
point_6 = Point(scale_9.Geometry)

move_4 = Move(Geometry=curve_49, Motion=Vector(2.5, 0, 0))  # -> Geometry, Transform
mirror_5 = Mirror(Geometry=curve_49, Plane=PlaneYZ(0, 0, 0))  # -> Geometry, Transform; disabled
curve_50 = Curve(move_4.Geometry)  # disabled

curve_51 = Curve(curve_49)
end_points_4 = EndPoints(Curve=curve_51)  # -> Start, End
rectangle_2pt_4 = Rectangle2Pt(Plane=PlaneXY(0, 0, 0), PointA=end_points_4.Start, PointB=end_points_4.End, Radius=0)  # -> Rectangle, Length
deconstuct_rectangle_2 = DeconstuctRectangle(Rectangle=rectangle_2pt_4.Rectangle)  # -> BasePlane, XInterval, YInterval
deconstruct_domain_3 = DeconstructDomain(Domain=deconstuct_rectangle_2.YInterval)  # -> Start, End
deconstruct_domain_4 = DeconstructDomain(Domain=deconstuct_rectangle_2.XInterval)  # -> Start, End
scale_nu_2 = ScaleNU(
    Geometry=curve_49,
    Plane=PlaneXY(0, 0, 0),
    ScaleX=expr("1/X", deconstruct_domain_4.End),
    ScaleY=expr("1/X", deconstruct_domain_3.End),
    ScaleZ=1)  # -> Geometry, Transform
curve_52 = Curve(scale_nu_2.Geometry)
move_5 = Move(Geometry=curve_52, Motion=Vector(2.5, 1.5, 0))  # -> Geometry, Transform
curve_53 = Curve(move_5.Geometry)  # disabled

stream_filter_5 = StreamFilter(Gate=number_slider_24, Stream0=curve_49, Stream1=curve_52)
curve_54 = Curve(stream_filter_5)
scale_11 = Scale(Geometry=curve_54, Center=Point(0, 0, 0), Factor=expr("2^X", number))  # -> Geometry, Transform
curve_55 = Curve(scale_11.Geometry)

stream_filter_6 = StreamFilter(Gate=number_slider_24, Stream0=curve_49, Stream1=curve_52)
curve_56 = Curve(stream_filter_6)
scale_12 = Scale(Geometry=curve_56, Center=Point(0, 0, 0), Factor=expr("2^X", number))  # -> Geometry, Transform
curve_57 = Curve(scale_12.Geometry)

end_points_5 = EndPoints(Curve=curve_55)  # -> Start, End
rectangle_2pt_5 = Rectangle2Pt(Plane=PlaneXY(0, 0, 0), PointA=end_points_5.Start, PointB=end_points_5.End, Radius=0)  # -> Rectangle, Length

number_14 = Number(number_5)

series_4 = Series(Start=0, Step=panel_61, Count=number_14)
expression_44 = Expression(O=series_4, Expression="FORMAT(\"{0:R}\",O)")  # disabled
panel_131 = Panel(expression_44)
bounds_3 = Bounds(Numbers=series_4)
expression_45 = Expression(X=number_14, Expression="1/X")
duplicate_data_4 = DuplicateData(Data=expression_45, Number=number_14, Order=True)

curve_graph_mapper_3 = CurveGraphMapper(Curves=curve_55, Rectangle=rectangle_2pt_5.Rectangle, Values=series_4, Flip=False, Snap=True, TextSize=0.015625)  # -> Mapped, GraphCurves, GraphPoints, ValueLines, ValuePoints, MappedLines, MappedPoints, Boundary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; disabled
graphmapper_3 = GraphMapper(Curve=curve_55, Boundary=rectangle_2pt_5.Rectangle, Numbers=series_4, Input=bounds_3, Output=bounds_3, bobo=False)  # disabled
stream_filter_7 = StreamFilter(Gate=number_slider_25, Stream0=curve_graph_mapper_3.Mapped, Stream1=graphmapper_3)

turtle_4 = DotNETVBScriptLEGACY(Forward=duplicate_data_4, Left=stream_filter_7)  # -> Output, Points; inputs Forward: list, Left: list; same code as turtle

expression_46 = Expression(O=turtle_4.Points, Expression="FORMAT(\"{0:R}\",O)")
panel_132 = Panel(expression_46)

point_7 = Point(turtle_4.Points)
scale_13 = Scale(Geometry=point_7, Center=Point(0, 0, 0), Factor=expr("2^X", digit_scroller_65))  # -> Geometry, Transform

interpolate_t_4 = InterpolateT(Vertices=scale_13.Geometry, TangentStart=Vector(0.0625, 0, 0), TangentEnd=Vector(0, 0, 0), KnotStyle=2)  # -> Curve, Length, Domain
evaluate_length_13 = EvaluateLength(Curve=interpolate_t_4.Curve, Length=1, Normalized=True)  # -> Point, Tangent, Parameter
line_sdl_7 = LineSDL(Start=evaluate_length_13.Point, Direction=evaluate_length_13.Tangent, Length=1)
mirror_6 = Mirror(Geometry=interpolate_t_4.Curve, Plane=line_sdl_7)  # -> Geometry, Transform
join_curves_7 = JoinCurves(Curves=[interpolate_t_4.Curve, mirror_6.Geometry], Preserve=False)
evaluate_length_14 = EvaluateLength(Curve=join_curves_7, Length=1, Normalized=True)  # -> Point, Tangent, Parameter
rotate_4 = Rotate(Geometry=join_curves_7, Angle=3.141592654, Plane=evaluate_length_14.Point)  # -> Geometry, Transform
join_curves_8 = JoinCurves(Curves=[join_curves_7, rotate_4.Geometry], Preserve=False)
curve_58 = Curve(join_curves_8)

evaluate_length_15 = EvaluateLength(Curve=join_curves_8, Length=1, Normalized=True)  # -> Point, Tangent, Parameter
deconstruct_7 = Deconstruct(Point=evaluate_length_15.Point)  # -> XComponent, YComponent, ZComponent
expression_47 = Expression(O=deconstruct_7.YComponent, Expression="FORMAT(\"{0:R}\",O)")
expression_48 = Expression(O=deconstruct_7.XComponent, Expression="FORMAT(\"{0:R}\",O)")
expression_49 = Expression(O=deconstruct_7.ZComponent, Expression="FORMAT(\"{0:R}\",O)")
panel_133 = Panel(expression_47)
panel_134 = Panel(expression_48)
panel_135 = Panel(expression_49)
addition_4 = Addition(A=panel_133, B=panel_134)
expression_50 = Expression(O=addition_4, Expression="FORMAT(\"{0:R}\",O)")
panel_136 = Panel(expression_50)
division_7 = Division(A=panel_136, B=2)
expression_51 = Expression(O=division_7, Expression="FORMAT(\"{0:R}\",O)")
panel_137 = Panel(expression_51)
scale_14 = Scale(Geometry=scale_13.Geometry, Center=Point(0, 0, 0), Factor=expr("1/X", panel_137))  # -> Geometry, Transform
scale_15 = Scale(Geometry=curve_58, Center=Point(0, 0, 0), Factor=expr("1/X", panel_137))  # -> Geometry, Transform
evaluate_length_16 = EvaluateLength(Curve=scale_15.Geometry, Length=1, Normalized=True)  # -> Point, Tangent, Parameter
deconstruct_8 = Deconstruct(Point=evaluate_length_16.Point)  # -> XComponent, YComponent, ZComponent
expression_52 = Expression(O=deconstruct_8.YComponent, Expression="FORMAT(\"{0:R}\",O)")
expression_53 = Expression(O=deconstruct_8.XComponent, Expression="FORMAT(\"{0:R}\",O)")
expression_54 = Expression(O=deconstruct_8.ZComponent, Expression="FORMAT(\"{0:R}\",O)")
panel_138 = Panel(expression_52)
panel_139 = Panel(expression_53)
panel_140 = Panel(expression_54)
division_8 = Division(A=panel_134, B=panel_133)
expression_55 = Expression(O=division_8, Expression="FORMAT(\"{0:R}\",O)")
panel_141 = Panel(expression_55)
curve_59 = Curve(scale_15.Geometry)
point_8 = Point(scale_14.Geometry)

move_6 = Move(Geometry=curve_59, Motion=vector_xyz_2.Vector)  # -> Geometry, Transform
mirror_7 = Mirror(Geometry=curve_59, Plane=PlaneYZ(0, 0, 0))  # -> Geometry, Transform; disabled
curve_60 = Curve(move_6.Geometry)

radians_9 = Radians(Degrees=number_3)

expression_56 = Expression(O=radians_9, Expression="FORMAT(\"{0:0.00000000000000000000}\",O)")
panel_143 = Panel(expression_56)
number_15 = Number(number_5)

end_points_6 = EndPoints(Curve=curve_57)  # -> Start, End
rectangle_2pt_6 = Rectangle2Pt(Plane=PlaneXY(0, 0, 0), PointA=end_points_6.Start, PointB=end_points_6.End, Radius=0)  # -> Rectangle, Length

series_5 = Series(Start=0, Step=panel_143, Count=number_15)
expression_57 = Expression(O=series_5, Expression="FORMAT(\"{0:R}\",O)")  # disabled
panel_144 = Panel(expression_57)
bounds_4 = Bounds(Numbers=series_5)
expression_58 = Expression(X=number_15, Expression="1/X")
duplicate_data_5 = DuplicateData(Data=expression_58, Number=number_15, Order=True)

curve_graph_mapper_4 = CurveGraphMapper(Curves=curve_57, Rectangle=rectangle_2pt_6.Rectangle, Values=series_5, Flip=False, Snap=True, TextSize=0.015625)  # -> Mapped, GraphCurves, GraphPoints, ValueLines, ValuePoints, MappedLines, MappedPoints, Boundary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; disabled
graphmapper_4 = GraphMapper(Curve=curve_57, Boundary=rectangle_2pt_6.Rectangle, Numbers=series_5, Input=bounds_4, Output=bounds_4, bobo=True)
stream_filter_8 = StreamFilter(Gate=number_slider_25, Stream0=curve_graph_mapper_4.Mapped, Stream1=graphmapper_4)

turtle_5 = DotNETVBScriptLEGACY(Forward=duplicate_data_5, Left=stream_filter_8)  # -> Output, Points; inputs Forward: list, Left: list; same code as turtle

expression_59 = Expression(O=turtle_5.Points, Expression="FORMAT(\"{0:R}\",O)")
panel_145 = Panel(expression_59)

point_9 = Point(turtle_5.Points)
scale_16 = Scale(Geometry=point_9, Center=Point(0, 0, 0), Factor=expr("2^X", digit_scroller_71))  # -> Geometry, Transform

interpolate_t_5 = InterpolateT(Vertices=scale_16.Geometry, TangentStart=Vector(0.0625, 0, 0), TangentEnd=Vector(0, 0, 0), KnotStyle=2)  # -> Curve, Length, Domain
evaluate_length_17 = EvaluateLength(Curve=interpolate_t_5.Curve, Length=1, Normalized=True)  # -> Point, Tangent, Parameter
line_sdl_8 = LineSDL(Start=evaluate_length_17.Point, Direction=evaluate_length_17.Tangent, Length=1)
mirror_8 = Mirror(Geometry=interpolate_t_5.Curve, Plane=line_sdl_8)  # -> Geometry, Transform
join_curves_9 = JoinCurves(Curves=[interpolate_t_5.Curve, mirror_8.Geometry], Preserve=False)
evaluate_length_18 = EvaluateLength(Curve=join_curves_9, Length=1, Normalized=True)  # -> Point, Tangent, Parameter
rotate_5 = Rotate(Geometry=join_curves_9, Angle=3.141592654, Plane=evaluate_length_18.Point)  # -> Geometry, Transform
join_curves_10 = JoinCurves(Curves=[join_curves_9, rotate_5.Geometry], Preserve=False)
curve_61 = Curve(join_curves_10)

evaluate_length_19 = EvaluateLength(Curve=join_curves_10, Length=1, Normalized=True)  # -> Point, Tangent, Parameter
deconstruct_9 = Deconstruct(Point=evaluate_length_19.Point)  # -> XComponent, YComponent, ZComponent
expression_60 = Expression(O=deconstruct_9.YComponent, Expression="FORMAT(\"{0:R}\",O)")
expression_61 = Expression(O=deconstruct_9.XComponent, Expression="FORMAT(\"{0:R}\",O)")
expression_62 = Expression(O=deconstruct_9.ZComponent, Expression="FORMAT(\"{0:R}\",O)")
panel_146 = Panel(expression_60)
panel_147 = Panel(expression_61)
panel_148 = Panel(expression_62)
addition_5 = Addition(A=panel_146, B=panel_147)
expression_63 = Expression(O=addition_5, Expression="FORMAT(\"{0:R}\",O)")
panel_149 = Panel(expression_63)
division_9 = Division(A=panel_149, B=2)
expression_64 = Expression(O=division_9, Expression="FORMAT(\"{0:R}\",O)")
panel_150 = Panel(expression_64)
scale_17 = Scale(Geometry=scale_16.Geometry, Center=Point(0, 0, 0), Factor=expr("1/X", panel_150))  # -> Geometry, Transform
scale_18 = Scale(Geometry=curve_61, Center=Point(0, 0, 0), Factor=expr("1/X", panel_150))  # -> Geometry, Transform
evaluate_length_20 = EvaluateLength(Curve=scale_18.Geometry, Length=1, Normalized=True)  # -> Point, Tangent, Parameter
deconstruct_10 = Deconstruct(Point=evaluate_length_20.Point)  # -> XComponent, YComponent, ZComponent
expression_65 = Expression(O=deconstruct_10.YComponent, Expression="FORMAT(\"{0:R}\",O)")
expression_66 = Expression(O=deconstruct_10.XComponent, Expression="FORMAT(\"{0:R}\",O)")
expression_67 = Expression(O=deconstruct_10.ZComponent, Expression="FORMAT(\"{0:R}\",O)")
panel_151 = Panel(expression_65)
panel_152 = Panel(expression_66)
panel_153 = Panel(expression_67)
division_10 = Division(A=panel_147, B=panel_146)
expression_68 = Expression(O=division_10, Expression="FORMAT(\"{0:R}\",O)")
panel_154 = Panel(expression_68)
curve_62 = Curve(scale_18.Geometry)
point_10 = Point(scale_17.Geometry)

move_7 = Move(Geometry=curve_62, Motion=Vector(5, 0, 0))  # -> Geometry, Transform
mirror_9 = Mirror(Geometry=curve_62, Plane=PlaneYZ(0, 0, 0))  # -> Geometry, Transform; disabled
curve_63 = Curve(move_7.Geometry)  # disabled

curve_64 = Curve(curve_62)
end_points_7 = EndPoints(Curve=curve_64)  # -> Start, End
rectangle_2pt_7 = Rectangle2Pt(Plane=PlaneXY(0, 0, 0), PointA=end_points_7.Start, PointB=end_points_7.End, Radius=0)  # -> Rectangle, Length
deconstuct_rectangle_3 = DeconstuctRectangle(Rectangle=rectangle_2pt_7.Rectangle)  # -> BasePlane, XInterval, YInterval
deconstruct_domain_5 = DeconstructDomain(Domain=deconstuct_rectangle_3.YInterval)  # -> Start, End
deconstruct_domain_6 = DeconstructDomain(Domain=deconstuct_rectangle_3.XInterval)  # -> Start, End
scale_nu_3 = ScaleNU(
    Geometry=curve_62,
    Plane=PlaneXY(0, 0, 0),
    ScaleX=expr("1/X", deconstruct_domain_6.End),
    ScaleY=expr("1/X", deconstruct_domain_5.End),
    ScaleZ=1)  # -> Geometry, Transform
curve_65 = Curve(scale_nu_3.Geometry)
move_8 = Move(Geometry=curve_65, Motion=vector_xyz_4.Vector)  # -> Geometry, Transform
curve_66 = Curve(move_8.Geometry)  # disabled

stream_filter_9 = StreamFilter(Gate=number_slider_24, Stream0=curve_62, Stream1=curve_65)
curve_67 = Curve(stream_filter_9)
scale_19 = Scale(Geometry=curve_67, Center=Point(0, 0, 0), Factor=expr("2^X", number))  # -> Geometry, Transform
curve_68 = Curve(scale_19.Geometry)

stream_filter_10 = StreamFilter(Gate=number_slider_24, Stream0=curve_62, Stream1=curve_65)
curve_69 = Curve(stream_filter_10)
scale_20 = Scale(Geometry=curve_69, Center=Point(0, 0, 0), Factor=expr("2^X", number))  # -> Geometry, Transform
curve_70 = Curve(scale_20.Geometry)

end_points_8 = EndPoints(Curve=curve_68)  # -> Start, End
rectangle_2pt_8 = Rectangle2Pt(Plane=PlaneXY(0, 0, 0), PointA=end_points_8.Start, PointB=end_points_8.End, Radius=0)  # -> Rectangle, Length

number_16 = Number(number_5)

series_6 = Series(Start=0, Step=panel_69, Count=number_16)
expression_69 = Expression(O=series_6, Expression="FORMAT(\"{0:R}\",O)")  # disabled
panel_156 = Panel(expression_69)
bounds_5 = Bounds(Numbers=series_6)
expression_70 = Expression(X=number_16, Expression="1/X")
duplicate_data_6 = DuplicateData(Data=expression_70, Number=number_16, Order=True)

curve_graph_mapper_5 = CurveGraphMapper(Curves=curve_68, Rectangle=rectangle_2pt_8.Rectangle, Values=series_6, Flip=False, Snap=True, TextSize=0.015625)  # -> Mapped, GraphCurves, GraphPoints, ValueLines, ValuePoints, MappedLines, MappedPoints, Boundary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; disabled
graphmapper_5 = GraphMapper(Curve=curve_68, Boundary=rectangle_2pt_8.Rectangle, Numbers=series_6, Input=bounds_5, Output=bounds_5, bobo=True)  # disabled
stream_filter_11 = StreamFilter(Gate=number_slider_25, Stream0=curve_graph_mapper_5.Mapped, Stream1=graphmapper_5)

turtle_6 = DotNETVBScriptLEGACY(Forward=duplicate_data_6, Left=stream_filter_11)  # -> Output, Points; inputs Forward: list, Left: list; same code as turtle

expression_71 = Expression(O=turtle_6.Points, Expression="FORMAT(\"{0:R}\",O)")
panel_157 = Panel(expression_71)

point_11 = Point(turtle_6.Points)
scale_21 = Scale(Geometry=point_11, Center=Point(0, 0, 0), Factor=expr("2^X", digit_scroller_72))  # -> Geometry, Transform

interpolate_t_6 = InterpolateT(Vertices=scale_21.Geometry, TangentStart=Vector(0.0625, 0, 0), TangentEnd=Vector(0, 0, 0), KnotStyle=2)  # -> Curve, Length, Domain
evaluate_length_21 = EvaluateLength(Curve=interpolate_t_6.Curve, Length=1, Normalized=True)  # -> Point, Tangent, Parameter
line_sdl_9 = LineSDL(Start=evaluate_length_21.Point, Direction=evaluate_length_21.Tangent, Length=1)
mirror_10 = Mirror(Geometry=interpolate_t_6.Curve, Plane=line_sdl_9)  # -> Geometry, Transform
join_curves_11 = JoinCurves(Curves=[interpolate_t_6.Curve, mirror_10.Geometry], Preserve=False)
evaluate_length_22 = EvaluateLength(Curve=join_curves_11, Length=1, Normalized=True)  # -> Point, Tangent, Parameter
rotate_6 = Rotate(Geometry=join_curves_11, Angle=3.141592654, Plane=evaluate_length_22.Point)  # -> Geometry, Transform
join_curves_12 = JoinCurves(Curves=[join_curves_11, rotate_6.Geometry], Preserve=False)
curve_71 = Curve(join_curves_12)

evaluate_length_23 = EvaluateLength(Curve=join_curves_12, Length=1, Normalized=True)  # -> Point, Tangent, Parameter
deconstruct_11 = Deconstruct(Point=evaluate_length_23.Point)  # -> XComponent, YComponent, ZComponent
expression_72 = Expression(O=deconstruct_11.YComponent, Expression="FORMAT(\"{0:R}\",O)")
expression_73 = Expression(O=deconstruct_11.XComponent, Expression="FORMAT(\"{0:R}\",O)")
expression_74 = Expression(O=deconstruct_11.ZComponent, Expression="FORMAT(\"{0:R}\",O)")
panel_158 = Panel(expression_72)
panel_159 = Panel(expression_73)
panel_160 = Panel(expression_74)
addition_6 = Addition(A=panel_158, B=panel_159)
expression_75 = Expression(O=addition_6, Expression="FORMAT(\"{0:R}\",O)")
panel_161 = Panel(expression_75)
division_11 = Division(A=panel_161, B=2)
expression_76 = Expression(O=division_11, Expression="FORMAT(\"{0:R}\",O)")
panel_162 = Panel(expression_76)
scale_22 = Scale(Geometry=scale_21.Geometry, Center=Point(0, 0, 0), Factor=expr("1/X", panel_162))  # -> Geometry, Transform
scale_23 = Scale(Geometry=curve_71, Center=Point(0, 0, 0), Factor=expr("1/X", panel_162))  # -> Geometry, Transform
evaluate_length_24 = EvaluateLength(Curve=scale_23.Geometry, Length=1, Normalized=True)  # -> Point, Tangent, Parameter
deconstruct_12 = Deconstruct(Point=evaluate_length_24.Point)  # -> XComponent, YComponent, ZComponent
expression_77 = Expression(O=deconstruct_12.YComponent, Expression="FORMAT(\"{0:R}\",O)")
expression_78 = Expression(O=deconstruct_12.XComponent, Expression="FORMAT(\"{0:R}\",O)")
expression_79 = Expression(O=deconstruct_12.ZComponent, Expression="FORMAT(\"{0:R}\",O)")
panel_163 = Panel(expression_77)
panel_164 = Panel(expression_78)
panel_165 = Panel(expression_79)
division_12 = Division(A=panel_159, B=panel_158)
expression_80 = Expression(O=division_12, Expression="FORMAT(\"{0:R}\",O)")
panel_166 = Panel(expression_80)
curve_72 = Curve(scale_23.Geometry)
point_12 = Point(scale_22.Geometry)

move_9 = Move(Geometry=curve_72, Motion=vector_xyz_3.Vector)  # -> Geometry, Transform
mirror_11 = Mirror(Geometry=curve_72, Plane=PlaneYZ(0, 0, 0))  # -> Geometry, Transform; disabled
curve_73 = Curve(move_9.Geometry)

number_17 = Number(number_5)

series_7 = Series(Start=0, Step=panel_73, Count=number_17)
expression_81 = Expression(O=series_7, Expression="FORMAT(\"{0:R}\",O)")  # disabled
panel_168 = Panel(expression_81)
bounds_6 = Bounds(Numbers=series_7)
expression_82 = Expression(X=number_17, Expression="1/X")
duplicate_data_7 = DuplicateData(Data=expression_82, Number=number_17, Order=True)

radians_10 = Radians(Degrees=number_3)

expression_83 = Expression(O=radians_10, Expression="FORMAT(\"{0:0.00000000000000000000}\",O)")
panel_169 = Panel(expression_83)
number_18 = Number(number_5)

end_points_9 = EndPoints(Curve=curve_70)  # -> Start, End
rectangle_2pt_9 = Rectangle2Pt(Plane=PlaneXY(0, 0, 0), PointA=end_points_9.Start, PointB=end_points_9.End, Radius=0)  # -> Rectangle, Length

series_8 = Series(Start=0, Step=panel_169, Count=number_18)
expression_84 = Expression(O=series_8, Expression="FORMAT(\"{0:R}\",O)")  # disabled
panel_170 = Panel(expression_84)
bounds_7 = Bounds(Numbers=series_8)
expression_85 = Expression(X=number_18, Expression="1/X")
duplicate_data_8 = DuplicateData(Data=expression_85, Number=number_18, Order=True)

curve_graph_mapper_6 = CurveGraphMapper(Curves=curve_70, Rectangle=rectangle_2pt_9.Rectangle, Values=series_8, Flip=False, Snap=True, TextSize=0.015625)  # -> Mapped, GraphCurves, GraphPoints, ValueLines, ValuePoints, MappedLines, MappedPoints, Boundary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; disabled
graphmapper_6 = GraphMapper(Curve=curve_70, Boundary=rectangle_2pt_9.Rectangle, Numbers=series_8, Input=bounds_7, Output=bounds_7, bobo=True)
stream_filter_12 = StreamFilter(Gate=number_slider_25, Stream0=curve_graph_mapper_6.Mapped, Stream1=graphmapper_6)

turtle_7 = DotNETVBScriptLEGACY(Forward=duplicate_data_8, Left=stream_filter_12)  # -> Output, Points; inputs Forward: list, Left: list; same code as turtle

expression_86 = Expression(O=turtle_7.Points, Expression="FORMAT(\"{0:R}\",O)")
panel_171 = Panel(expression_86)

point_13 = Point(turtle_7.Points)
scale_24 = Scale(Geometry=point_13, Center=Point(0, 0, 0), Factor=expr("2^X", digit_scroller_82))  # -> Geometry, Transform

interpolate_t_7 = InterpolateT(Vertices=scale_24.Geometry, TangentStart=Vector(0.0625, 0, 0), TangentEnd=Vector(0, 0, 0), KnotStyle=2)  # -> Curve, Length, Domain
evaluate_length_25 = EvaluateLength(Curve=interpolate_t_7.Curve, Length=1, Normalized=True)  # -> Point, Tangent, Parameter
line_sdl_10 = LineSDL(Start=evaluate_length_25.Point, Direction=evaluate_length_25.Tangent, Length=1)
mirror_12 = Mirror(Geometry=interpolate_t_7.Curve, Plane=line_sdl_10)  # -> Geometry, Transform
join_curves_13 = JoinCurves(Curves=[interpolate_t_7.Curve, mirror_12.Geometry], Preserve=False)
evaluate_length_26 = EvaluateLength(Curve=join_curves_13, Length=1, Normalized=True)  # -> Point, Tangent, Parameter
rotate_7 = Rotate(Geometry=join_curves_13, Angle=3.141592654, Plane=evaluate_length_26.Point)  # -> Geometry, Transform
join_curves_14 = JoinCurves(Curves=[join_curves_13, rotate_7.Geometry], Preserve=False)
curve_74 = Curve(join_curves_14)

evaluate_length_27 = EvaluateLength(Curve=join_curves_14, Length=1, Normalized=True)  # -> Point, Tangent, Parameter
deconstruct_13 = Deconstruct(Point=evaluate_length_27.Point)  # -> XComponent, YComponent, ZComponent
expression_87 = Expression(O=deconstruct_13.YComponent, Expression="FORMAT(\"{0:R}\",O)")
expression_88 = Expression(O=deconstruct_13.XComponent, Expression="FORMAT(\"{0:R}\",O)")
expression_89 = Expression(O=deconstruct_13.ZComponent, Expression="FORMAT(\"{0:R}\",O)")
panel_172 = Panel(expression_87)
panel_173 = Panel(expression_88)
panel_174 = Panel(expression_89)
addition_7 = Addition(A=panel_172, B=panel_173)
expression_90 = Expression(O=addition_7, Expression="FORMAT(\"{0:R}\",O)")
panel_175 = Panel(expression_90)
division_13 = Division(A=panel_175, B=2)
expression_91 = Expression(O=division_13, Expression="FORMAT(\"{0:R}\",O)")
panel_176 = Panel(expression_91)
scale_25 = Scale(Geometry=scale_24.Geometry, Center=Point(0, 0, 0), Factor=expr("1/X", panel_176))  # -> Geometry, Transform
scale_26 = Scale(Geometry=curve_74, Center=Point(0, 0, 0), Factor=expr("1/X", panel_176))  # -> Geometry, Transform
evaluate_length_28 = EvaluateLength(Curve=scale_26.Geometry, Length=1, Normalized=True)  # -> Point, Tangent, Parameter
deconstruct_14 = Deconstruct(Point=evaluate_length_28.Point)  # -> XComponent, YComponent, ZComponent
expression_92 = Expression(O=deconstruct_14.YComponent, Expression="FORMAT(\"{0:R}\",O)")
expression_93 = Expression(O=deconstruct_14.XComponent, Expression="FORMAT(\"{0:R}\",O)")
expression_94 = Expression(O=deconstruct_14.ZComponent, Expression="FORMAT(\"{0:R}\",O)")
panel_177 = Panel(expression_92)
panel_178 = Panel(expression_93)
panel_179 = Panel(expression_94)
division_14 = Division(A=panel_173, B=panel_172)
expression_95 = Expression(O=division_14, Expression="FORMAT(\"{0:R}\",O)")
panel_180 = Panel(expression_95)
curve_75 = Curve(scale_26.Geometry)
point_14 = Point(scale_25.Geometry)

move_10 = Move(Geometry=curve_75, Motion=Vector(7.5, 0, 0))  # -> Geometry, Transform
mirror_13 = Mirror(Geometry=curve_75, Plane=PlaneYZ(0, 0, 0))  # -> Geometry, Transform; disabled
curve_76 = Curve(move_10.Geometry)  # disabled

curve_77 = Curve(curve_75)
end_points_10 = EndPoints(Curve=curve_77)  # -> Start, End
rectangle_2pt_10 = Rectangle2Pt(Plane=PlaneXY(0, 0, 0), PointA=end_points_10.Start, PointB=end_points_10.End, Radius=0)  # -> Rectangle, Length
deconstuct_rectangle_4 = DeconstuctRectangle(Rectangle=rectangle_2pt_10.Rectangle)  # -> BasePlane, XInterval, YInterval
deconstruct_domain_7 = DeconstructDomain(Domain=deconstuct_rectangle_4.YInterval)  # -> Start, End
deconstruct_domain_8 = DeconstructDomain(Domain=deconstuct_rectangle_4.XInterval)  # -> Start, End
scale_nu_4 = ScaleNU(
    Geometry=curve_75,
    Plane=PlaneXY(0, 0, 0),
    ScaleX=expr("1/X", deconstruct_domain_8.End),
    ScaleY=expr("1/X", deconstruct_domain_7.End),
    ScaleZ=1)  # -> Geometry, Transform
curve_78 = Curve(scale_nu_4.Geometry)
move_11 = Move(Geometry=curve_78, Motion=vector_xyz_7.Vector)  # -> Geometry, Transform
curve_79 = Curve(move_11.Geometry)  # disabled

stream_filter_13 = StreamFilter(Gate=number_slider_24, Stream0=curve_75, Stream1=curve_78)
curve_80 = Curve(stream_filter_13)
scale_27 = Scale(Geometry=curve_80, Center=Point(0, 0, 0), Factor=expr("2^X", number))  # -> Geometry, Transform
curve_81 = Curve(scale_27.Geometry)

stream_filter_14 = StreamFilter(Gate=number_slider_24, Stream0=curve_75, Stream1=curve_78)
curve_82 = Curve(stream_filter_14)
scale_28 = Scale(Geometry=curve_82, Center=Point(0, 0, 0), Factor=expr("2^X", number))  # -> Geometry, Transform
curve_83 = Curve(scale_28.Geometry)

end_points_11 = EndPoints(Curve=curve_81)  # -> Start, End
rectangle_2pt_11 = Rectangle2Pt(Plane=PlaneXY(0, 0, 0), PointA=end_points_11.Start, PointB=end_points_11.End, Radius=0)  # -> Rectangle, Length

number_19 = Number(number_5)

series_9 = Series(Start=0, Step=panel_81, Count=number_19)
expression_96 = Expression(O=series_9, Expression="FORMAT(\"{0:R}\",O)")  # disabled
panel_182 = Panel(expression_96)
bounds_8 = Bounds(Numbers=series_9)
expression_97 = Expression(X=number_19, Expression="1/X")
duplicate_data_9 = DuplicateData(Data=expression_97, Number=number_19, Order=True)

curve_graph_mapper_7 = CurveGraphMapper(Curves=curve_81, Rectangle=rectangle_2pt_11.Rectangle, Values=series_9, Flip=False, Snap=True, TextSize=0.015625)  # -> Mapped, GraphCurves, GraphPoints, ValueLines, ValuePoints, MappedLines, MappedPoints, Boundary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; disabled
graphmapper_7 = GraphMapper(Curve=curve_81, Boundary=rectangle_2pt_11.Rectangle, Numbers=series_9, Input=bounds_8, Output=bounds_8, bobo=True)  # disabled
stream_filter_15 = StreamFilter(Gate=number_slider_25, Stream0=curve_graph_mapper_7.Mapped, Stream1=graphmapper_7)

turtle_8 = DotNETVBScriptLEGACY(Forward=duplicate_data_9, Left=stream_filter_15)  # -> Output, Points; inputs Forward: list, Left: list; same code as turtle

expression_98 = Expression(O=turtle_8.Points, Expression="FORMAT(\"{0:R}\",O)")
panel_183 = Panel(expression_98)

point_15 = Point(turtle_8.Points)
scale_29 = Scale(Geometry=point_15, Center=Point(0, 0, 0), Factor=expr("2^X", digit_scroller_83))  # -> Geometry, Transform

interpolate_t_8 = InterpolateT(Vertices=scale_29.Geometry, TangentStart=Vector(0.0625, 0, 0), TangentEnd=Vector(0, 0, 0), KnotStyle=2)  # -> Curve, Length, Domain
evaluate_length_29 = EvaluateLength(Curve=interpolate_t_8.Curve, Length=1, Normalized=True)  # -> Point, Tangent, Parameter
line_sdl_11 = LineSDL(Start=evaluate_length_29.Point, Direction=evaluate_length_29.Tangent, Length=1)
mirror_14 = Mirror(Geometry=interpolate_t_8.Curve, Plane=line_sdl_11)  # -> Geometry, Transform
join_curves_15 = JoinCurves(Curves=[interpolate_t_8.Curve, mirror_14.Geometry], Preserve=False)
evaluate_length_30 = EvaluateLength(Curve=join_curves_15, Length=1, Normalized=True)  # -> Point, Tangent, Parameter
rotate_8 = Rotate(Geometry=join_curves_15, Angle=3.141592654, Plane=evaluate_length_30.Point)  # -> Geometry, Transform
join_curves_16 = JoinCurves(Curves=[join_curves_15, rotate_8.Geometry], Preserve=False)
curve_84 = Curve(join_curves_16)

evaluate_length_31 = EvaluateLength(Curve=join_curves_16, Length=1, Normalized=True)  # -> Point, Tangent, Parameter
deconstruct_15 = Deconstruct(Point=evaluate_length_31.Point)  # -> XComponent, YComponent, ZComponent
expression_99 = Expression(O=deconstruct_15.YComponent, Expression="FORMAT(\"{0:R}\",O)")
expression_100 = Expression(O=deconstruct_15.XComponent, Expression="FORMAT(\"{0:R}\",O)")
expression_101 = Expression(O=deconstruct_15.ZComponent, Expression="FORMAT(\"{0:R}\",O)")
panel_184 = Panel(expression_99)
panel_185 = Panel(expression_100)
panel_186 = Panel(expression_101)
addition_8 = Addition(A=panel_184, B=panel_185)
expression_102 = Expression(O=addition_8, Expression="FORMAT(\"{0:R}\",O)")
panel_187 = Panel(expression_102)
division_15 = Division(A=panel_187, B=2)
expression_103 = Expression(O=division_15, Expression="FORMAT(\"{0:R}\",O)")
panel_188 = Panel(expression_103)
scale_30 = Scale(Geometry=scale_29.Geometry, Center=Point(0, 0, 0), Factor=expr("1/X", panel_188))  # -> Geometry, Transform
scale_31 = Scale(Geometry=curve_84, Center=Point(0, 0, 0), Factor=expr("1/X", panel_188))  # -> Geometry, Transform
evaluate_length_32 = EvaluateLength(Curve=scale_31.Geometry, Length=1, Normalized=True)  # -> Point, Tangent, Parameter
deconstruct_16 = Deconstruct(Point=evaluate_length_32.Point)  # -> XComponent, YComponent, ZComponent
expression_104 = Expression(O=deconstruct_16.YComponent, Expression="FORMAT(\"{0:R}\",O)")
expression_105 = Expression(O=deconstruct_16.XComponent, Expression="FORMAT(\"{0:R}\",O)")
expression_106 = Expression(O=deconstruct_16.ZComponent, Expression="FORMAT(\"{0:R}\",O)")
panel_189 = Panel(expression_104)
panel_190 = Panel(expression_105)
panel_191 = Panel(expression_106)
division_16 = Division(A=panel_185, B=panel_184)
expression_107 = Expression(O=division_16, Expression="FORMAT(\"{0:R}\",O)")
panel_192 = Panel(expression_107)
curve_85 = Curve(scale_31.Geometry)
point_16 = Point(scale_30.Geometry)

move_12 = Move(Geometry=curve_85, Motion=vector_xyz_6.Vector)  # -> Geometry, Transform
mirror_15 = Mirror(Geometry=curve_85, Plane=PlaneYZ(0, 0, 0))  # -> Geometry, Transform; disabled
curve_86 = Curve(move_12.Geometry)

number_20 = Number(expr("X*4", number_4))
divide_curve_2 = DivideCurve(Curve=line_sdl_3, Count=expr("X", number_20), Kinks=False)  # -> Points, Tangents, Parameters
line_sdl_12 = LineSDL(Start=divide_curve_2.Points, Direction=Vector(0, 1, 0), Length=1)
scale_32 = Scale(Geometry=line_sdl_12, Center=Point(0, 0, 0), Factor=expr("2^X", number_2))  # -> Geometry, Transform

number_21 = Number(expr("X*4", number_4))  # disabled

radians_11 = Radians(Degrees=number_3)

expression_108 = Expression(O=radians_11, Expression="FORMAT(\"{0:0.00000000000000000000}\",O)")
panel_194 = Panel(expression_108)
number_22 = Number(number_5)

end_points_12 = EndPoints(Curve=curve_83)  # -> Start, End
rectangle_2pt_12 = Rectangle2Pt(Plane=PlaneXY(0, 0, 0), PointA=end_points_12.Start, PointB=end_points_12.End, Radius=0)  # -> Rectangle, Length

series_10 = Series(Start=0, Step=panel_194, Count=number_22)
expression_109 = Expression(O=series_10, Expression="FORMAT(\"{0:R}\",O)")  # disabled
panel_195 = Panel(expression_109)
bounds_9 = Bounds(Numbers=series_10)
expression_110 = Expression(X=number_22, Expression="1/X")
duplicate_data_10 = DuplicateData(Data=expression_110, Number=number_22, Order=True)

curve_graph_mapper_8 = CurveGraphMapper(Curves=curve_83, Rectangle=rectangle_2pt_12.Rectangle, Values=series_10, Flip=False, Snap=True, TextSize=0.015625)  # -> Mapped, GraphCurves, GraphPoints, ValueLines, ValuePoints, MappedLines, MappedPoints, Boundary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; disabled
graphmapper_8 = GraphMapper(Curve=curve_83, Boundary=rectangle_2pt_12.Rectangle, Numbers=series_10, Input=bounds_9, Output=bounds_9, bobo=True)
stream_filter_16 = StreamFilter(Gate=number_slider_25, Stream0=curve_graph_mapper_8.Mapped, Stream1=graphmapper_8)

turtle_9 = DotNETVBScriptLEGACY(Forward=duplicate_data_10, Left=stream_filter_16)  # -> Output, Points; inputs Forward: list, Left: list; same code as turtle

expression_111 = Expression(O=turtle_9.Points, Expression="FORMAT(\"{0:R}\",O)")
panel_196 = Panel(expression_111)

point_17 = Point(turtle_9.Points)
scale_33 = Scale(Geometry=point_17, Center=Point(0, 0, 0), Factor=expr("2^X", digit_scroller_91))  # -> Geometry, Transform

interpolate_t_9 = InterpolateT(Vertices=scale_33.Geometry, TangentStart=Vector(0.0625, 0, 0), TangentEnd=Vector(0, 0, 0), KnotStyle=2)  # -> Curve, Length, Domain
evaluate_length_33 = EvaluateLength(Curve=interpolate_t_9.Curve, Length=1, Normalized=True)  # -> Point, Tangent, Parameter
line_sdl_13 = LineSDL(Start=evaluate_length_33.Point, Direction=evaluate_length_33.Tangent, Length=1)
mirror_16 = Mirror(Geometry=interpolate_t_9.Curve, Plane=line_sdl_13)  # -> Geometry, Transform
join_curves_17 = JoinCurves(Curves=[interpolate_t_9.Curve, mirror_16.Geometry], Preserve=False)
evaluate_length_34 = EvaluateLength(Curve=join_curves_17, Length=1, Normalized=True)  # -> Point, Tangent, Parameter
rotate_9 = Rotate(Geometry=join_curves_17, Angle=3.141592654, Plane=evaluate_length_34.Point)  # -> Geometry, Transform
join_curves_18 = JoinCurves(Curves=[join_curves_17, rotate_9.Geometry], Preserve=False)
curve_87 = Curve(join_curves_18)

evaluate_length_35 = EvaluateLength(Curve=join_curves_18, Length=1, Normalized=True)  # -> Point, Tangent, Parameter
deconstruct_17 = Deconstruct(Point=evaluate_length_35.Point)  # -> XComponent, YComponent, ZComponent
expression_112 = Expression(O=deconstruct_17.YComponent, Expression="FORMAT(\"{0:R}\",O)")
expression_113 = Expression(O=deconstruct_17.XComponent, Expression="FORMAT(\"{0:R}\",O)")
expression_114 = Expression(O=deconstruct_17.ZComponent, Expression="FORMAT(\"{0:R}\",O)")
panel_197 = Panel(expression_112)
panel_198 = Panel(expression_113)
panel_199 = Panel(expression_114)
addition_9 = Addition(A=panel_197, B=panel_198)
expression_115 = Expression(O=addition_9, Expression="FORMAT(\"{0:R}\",O)")
panel_200 = Panel(expression_115)
division_17 = Division(A=panel_200, B=2)
expression_116 = Expression(O=division_17, Expression="FORMAT(\"{0:R}\",O)")
panel_201 = Panel(expression_116)
scale_34 = Scale(Geometry=scale_33.Geometry, Center=Point(0, 0, 0), Factor=expr("1/X", panel_201))  # -> Geometry, Transform
scale_35 = Scale(Geometry=curve_87, Center=Point(0, 0, 0), Factor=expr("1/X", panel_201))  # -> Geometry, Transform
evaluate_length_36 = EvaluateLength(Curve=scale_35.Geometry, Length=1, Normalized=True)  # -> Point, Tangent, Parameter
deconstruct_18 = Deconstruct(Point=evaluate_length_36.Point)  # -> XComponent, YComponent, ZComponent
expression_117 = Expression(O=deconstruct_18.YComponent, Expression="FORMAT(\"{0:R}\",O)")
expression_118 = Expression(O=deconstruct_18.XComponent, Expression="FORMAT(\"{0:R}\",O)")
expression_119 = Expression(O=deconstruct_18.ZComponent, Expression="FORMAT(\"{0:R}\",O)")
panel_202 = Panel(expression_117)
panel_203 = Panel(expression_118)
panel_204 = Panel(expression_119)
division_18 = Division(A=panel_198, B=panel_197)
expression_120 = Expression(O=division_18, Expression="FORMAT(\"{0:R}\",O)")
panel_205 = Panel(expression_120)
curve_88 = Curve(scale_35.Geometry)
point_18 = Point(scale_34.Geometry)

move_13 = Move(Geometry=curve_88, Motion=Vector(10, 0, 0))  # -> Geometry, Transform
mirror_17 = Mirror(Geometry=curve_88, Plane=PlaneYZ(0, 0, 0))  # -> Geometry, Transform; disabled
curve_89 = Curve(move_13.Geometry)

curve_90 = Curve(curve_88)
end_points_13 = EndPoints(Curve=curve_90)  # -> Start, End
rectangle_2pt_13 = Rectangle2Pt(Plane=PlaneXY(0, 0, 0), PointA=end_points_13.Start, PointB=end_points_13.End, Radius=0)  # -> Rectangle, Length
deconstuct_rectangle_5 = DeconstuctRectangle(Rectangle=rectangle_2pt_13.Rectangle)  # -> BasePlane, XInterval, YInterval
deconstruct_domain_9 = DeconstructDomain(Domain=deconstuct_rectangle_5.YInterval)  # -> Start, End
deconstruct_domain_10 = DeconstructDomain(Domain=deconstuct_rectangle_5.XInterval)  # -> Start, End
scale_nu_5 = ScaleNU(
    Geometry=curve_88,
    Plane=PlaneXY(0, 0, 0),
    ScaleX=expr("1/X", deconstruct_domain_10.End),
    ScaleY=expr("1/X", deconstruct_domain_9.End),
    ScaleZ=1)  # -> Geometry, Transform
curve_91 = Curve(scale_nu_5.Geometry)
move_14 = Move(Geometry=curve_91, Motion=vector_xyz_9.Vector)  # -> Geometry, Transform
curve_92 = Curve(move_14.Geometry)

stream_filter_17 = StreamFilter(Gate=number_slider_24, Stream0=curve_88, Stream1=curve_91)
curve_93 = Curve(stream_filter_17)
scale_36 = Scale(Geometry=curve_93, Center=Point(0, 0, 0), Factor=expr("2^X", number))  # -> Geometry, Transform
curve_94 = Curve(scale_36.Geometry)

stream_filter_18 = StreamFilter(Gate=number_slider_24, Stream0=curve_88, Stream1=curve_91)
curve_95 = Curve(stream_filter_18)
scale_37 = Scale(Geometry=curve_95, Center=Point(0, 0, 0), Factor=expr("2^X", number))  # -> Geometry, Transform
curve_96 = Curve(scale_37.Geometry)

stream_filter_19 = StreamFilter(Gate=number_slider_24, Stream0=curve_88, Stream1=curve_91)
curve_97 = Curve(stream_filter_19)
scale_38 = Scale(Geometry=curve_97, Center=Point(0, 0, 0), Factor=expr("2^X", number))  # -> Geometry, Transform
curve_98 = Curve(scale_38.Geometry)

end_points_14 = EndPoints(Curve=curve_94)  # -> Start, End
rectangle_2pt_14 = Rectangle2Pt(Plane=PlaneXY(0, 0, 0), PointA=end_points_14.Start, PointB=end_points_14.End, Radius=0)  # -> Rectangle, Length
curve_graph_mapper_9 = CurveGraphMapper(Curves=curve_94, Rectangle=rectangle_2pt_14.Rectangle, Values=series_7, Flip=False, Snap=True, TextSize=0.015625)  # -> Mapped, GraphCurves, GraphPoints, ValueLines, ValuePoints, MappedLines, MappedPoints, Boundary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; disabled
graphmapper_9 = GraphMapper(Curve=curve_94, Boundary=rectangle_2pt_14.Rectangle, Numbers=series_7, Input=bounds_6, Output=bounds_6, bobo=True)
stream_filter_20 = StreamFilter(Gate=number_slider_25, Stream0=curve_graph_mapper_9.Mapped, Stream1=graphmapper_9)

turtle_10 = DotNETVBScriptLEGACY(Forward=duplicate_data_7, Left=stream_filter_20)  # -> Output, Points; inputs Forward: list, Left: list; same code as turtle

expression_121 = Expression(O=turtle_10.Points, Expression="FORMAT(\"{0:R}\",O)")
panel_207 = Panel(expression_121)

point_19 = Point(turtle_10.Points)
scale_39 = Scale(Geometry=point_19, Center=Point(0, 0, 0), Factor=expr("2^X", digit_scroller_76))  # -> Geometry, Transform

interpolate_t_10 = InterpolateT(Vertices=scale_39.Geometry, TangentStart=Vector(0.0625, 0, 0), TangentEnd=Vector(0, 0, 0), KnotStyle=2)  # -> Curve, Length, Domain
evaluate_length_37 = EvaluateLength(Curve=interpolate_t_10.Curve, Length=1, Normalized=True)  # -> Point, Tangent, Parameter
line_sdl_14 = LineSDL(Start=evaluate_length_37.Point, Direction=evaluate_length_37.Tangent, Length=1)
mirror_18 = Mirror(Geometry=interpolate_t_10.Curve, Plane=line_sdl_14)  # -> Geometry, Transform
join_curves_19 = JoinCurves(Curves=[interpolate_t_10.Curve, mirror_18.Geometry], Preserve=False)
evaluate_length_38 = EvaluateLength(Curve=join_curves_19, Length=1, Normalized=True)  # -> Point, Tangent, Parameter
rotate_10 = Rotate(Geometry=join_curves_19, Angle=3.141592654, Plane=evaluate_length_38.Point)  # -> Geometry, Transform
join_curves_20 = JoinCurves(Curves=[join_curves_19, rotate_10.Geometry], Preserve=False)
curve_99 = Curve(interpolate_t_10.Curve)

evaluate_length_39 = EvaluateLength(Curve=join_curves_20, Length=1, Normalized=True)  # -> Point, Tangent, Parameter
deconstruct_19 = Deconstruct(Point=evaluate_length_39.Point)  # -> XComponent, YComponent, ZComponent
expression_122 = Expression(O=deconstruct_19.YComponent, Expression="FORMAT(\"{0:R}\",O)")
expression_123 = Expression(O=deconstruct_19.XComponent, Expression="FORMAT(\"{0:R}\",O)")
expression_124 = Expression(O=deconstruct_19.ZComponent, Expression="FORMAT(\"{0:R}\",O)")
panel_208 = Panel(expression_122)
panel_209 = Panel(expression_123)
panel_210 = Panel(expression_124)
addition_10 = Addition(A=panel_208, B=panel_209)
expression_125 = Expression(O=addition_10, Expression="FORMAT(\"{0:R}\",O)")
panel_211 = Panel(expression_125)
division_19 = Division(A=panel_211, B=2)
expression_126 = Expression(O=division_19, Expression="FORMAT(\"{0:R}\",O)")
panel_212 = Panel(expression_126)
scale_40 = Scale(Geometry=scale_39.Geometry, Center=Point(0, 0, 0), Factor=expr("1/X", panel_212))  # -> Geometry, Transform
scale_41 = Scale(Geometry=curve_99, Center=Point(0, 0, 0), Factor=expr("1/X", panel_212))  # -> Geometry, Transform
evaluate_length_40 = EvaluateLength(Curve=scale_41.Geometry, Length=1, Normalized=True)  # -> Point, Tangent, Parameter
deconstruct_20 = Deconstruct(Point=evaluate_length_40.Point)  # -> XComponent, YComponent, ZComponent
expression_127 = Expression(O=deconstruct_20.YComponent, Expression="FORMAT(\"{0:R}\",O)")
expression_128 = Expression(O=deconstruct_20.XComponent, Expression="FORMAT(\"{0:R}\",O)")
expression_129 = Expression(O=deconstruct_20.ZComponent, Expression="FORMAT(\"{0:R}\",O)")
panel_213 = Panel(expression_127)
panel_214 = Panel(expression_128)
panel_215 = Panel(expression_129)
division_20 = Division(A=panel_209, B=panel_208)
expression_130 = Expression(O=division_20, Expression="FORMAT(\"{0:R}\",O)")
panel_216 = Panel(expression_130)
curve_100 = Curve(scale_41.Geometry)
point_20 = Point(scale_40.Geometry)

curve_101 = Curve(curve_100)

move_15 = Move(Geometry=curve_100, Motion=vector_xyz_5.Vector)  # -> Geometry, Transform
mirror_19 = Mirror(Geometry=curve_100, Plane=PlaneYZ(0, 0, 0))  # -> Geometry, Transform; disabled
curve_102 = Curve(move_15.Geometry)

scale_42 = Scale(Geometry=scale_41.Geometry, Center=Point(0, 0, 0), Factor=expr("1/X", deconstruct_20.XComponent))  # -> Geometry, Transform
mirror_20 = Mirror(Geometry=scale_42.Geometry, Plane=xz_plane_2)  # -> Geometry, Transform
mirror_21 = Mirror(Geometry=mirror_20.Geometry, Plane=PlaneYZ(0, 0, 0))  # -> Geometry, Transform
move_16 = Move(Geometry=mirror_21.Geometry, Motion=Vector(1, 1, 0))  # -> Geometry, Transform
bounding_box = BoundingBox(Content=move_16.Geometry, Plane=PlaneXY(0, 0, 0), UnionBox=True)  # -> Box, Box_2
deconstruct_box = DeconstructBox(Box=bounding_box.Box)  # -> Plane, X, Y, Z

angle = Angle(VectorA=Vector(10902, 0, 0), VectorB=line_sdl_14)  # -> Angle, Reflex
degrees = Degrees(Radians=angle.Angle)
expression_131 = Expression(O=degrees, Expression="FORMAT(\"{0:R}\",O)")
panel_218 = Panel(expression_131)

curve_103 = Curve(move_16.Geometry)

curve_104 = Curve(curve_103)
scale_43 = Scale(Geometry=curve_104, Center=Point(0, 0, 0), Factor=expr("2^X", number_2))  # -> Geometry, Transform
curve_curve = CurveCurve(CurveA=scale_43.Geometry, CurveB=scale_32.Geometry)  # -> flatten(Points), ParamsA, ParamsB
scale_44 = Scale(Geometry=curve_curve.Points, Center=Point(0, 0, 0), Factor=expr("1/2^X", number_2))  # -> Geometry, Transform
deconstruct_21 = Deconstruct(Point=scale_44.Geometry)  # -> expr("ABS(X)", graft(XComponent)), expr("ABS(X)", graft(YComponent)), expr("ABS(X)", graft(ZComponent))
construct_point_2 = ConstructPoint(XCoordinate=deconstruct_21.XComponent, YCoordinate=deconstruct_21.YComponent, ZCoordinate=deconstruct_21.ZComponent)
list_length = ListLength(List=scale_44.Geometry)
panel_219 = Panel(list_length)
construct_domain = ConstructDomain(DomainStart=0, DomainEnd=expr("X-2", panel_219))
range = Range(Domain=construct_domain, Steps=expr("X-2", panel_219))
list_item = ListItem(List=flatten(construct_point_2), Index=range, Wrap=False)  # -> flatten(Item)
rotate_11 = Rotate(Geometry=list_item, Angle=3.141592654, Plane=construct_point)  # -> reverse(flatten(Geometry)), Transform
merge = Merge(Data1=list_item, Data2=construct_point, Data3=rotate_11.Geometry)
deconstruct_22 = Deconstruct(Point=merge)  # -> graft(XComponent), graft(YComponent), ZComponent
expression_132 = Expression(O=deconstruct_22.XComponent, Expression="FORMAT(\"{0:0.0000000000}\",O)")
expression_133 = Expression(O=deconstruct_22.XComponent, Expression="FORMAT(\"{0:R}\",O)")
data = Data(expression_132)
panel_220 = Panel(data)
expression_134 = Expression(O=deconstruct_22.YComponent, Expression="FORMAT(\"{0:0.00000000000000}\",O)")
expression_135 = Expression(O=deconstruct_21.YComponent, Expression="FORMAT(\"{0:R}\",O)")
data_2 = Data(expression_135)
panel_221 = Panel(data_2)
txtwriter = VBScript(filePath=file_path, data=flatten(panel_221), activate=Button())  # -> out, A; inputs data: list
# ---------- txtwriter: VB ----------
    If activate Then

      Dim i As Integer
      Dim aryText(4) As String

      aryText(0) = "Mary WriteLine"
      aryText(1) = "Had"
      aryText(2) = "Another"
      aryText(3) = "Little"
      aryText(4) = "One"

      ' the data is appended to the file. If file doesnt exist, a new file is created
      Dim objWriter As New System.IO.StreamWriter(filePath, append)

      For i = 0 To data.Count - 1
        objWriter.WriteLine(data(i))
      Next

      objWriter.Close()

    End If

    If clearFile Then
      Dim objWriter As New System.IO.StreamWriter(filePath, False)
      objWriter.Close()
    End If
# ---------- end txtwriter ----------

curve_105 = Curve(curve_103)  # disabled
divide_curve_3 = DivideCurve(Curve=curve_105, Count=number_21, Kinks=False)  # -> Points, Tangents, Parameters; disabled
deconstruct_23 = Deconstruct(Point=divide_curve_3.Points)  # -> graft(XComponent), graft(YComponent), ZComponent; disabled
expression_136 = Expression(Y=deconstruct_23.YComponent, Expression="FORMAT(\"{0:R}\",ROUND(Y, 15))")  # -> simplify(Result); disabled
expression_137 = Expression(X=deconstruct_23.XComponent, Expression="FORMAT(\"{0:R}\",ROUND(X, 15))")  # -> simplify(Result); disabled
expression_138 = Expression(X=deconstruct_23.XComponent, Expression="FORMAT(\"{0:R}\",X)")  # -> simplify(Result); disabled
panel_222 = Panel(expression_138)  # disabled
expression_139 = Expression(Y=deconstruct_23.YComponent, Expression="FORMAT(\"{0:R}\",Y)")  # -> simplify(Result); disabled
list_length_2 = ListLength(List=divide_curve_3.Points)  # disabled
duplicate_data_11 = DuplicateData(Data=",", Number=list_length_2, Order=True)  # -> simplify(graft(Data)); disabled
panel_223 = Panel(duplicate_data_11)  # disabled
panel_224 = Panel(expression_139)  # disabled
concatenate = Concatenate(FragmentA=panel_222, FragmentB=panel_223, FragmentA_2=panel_224)  # -> flatten(Result); disabled
panel_225 = Panel(concatenate)  # disabled
txtwriter_2 = VBScript(filePath=file_path_2, data=flatten(panel_225), activate=button)  # -> out, A; inputs data: list; disabled; same code as txtwriter

number_23 = Number(expr("X*4", number_4))  # disabled
curve_106 = Curve(curve_103)  # disabled
evaluate_length_41 = EvaluateLength(Curve=curve_106, Length=flatten(1), Normalized=True)  # -> Point, Tangent, Parameter; disabled
yz_plane_2 = YZPlane(Origin=evaluate_length_41.Point)  # disabled
mirror_22 = Mirror(Geometry=curve_106, Plane=yz_plane_2)  # -> Geometry, Transform; disabled
join_curves_21 = JoinCurves(Curves=[curve_106, mirror_22.Geometry], Preserve=False)  # disabled
linear_array = LinearArray(Geometry=join_curves_21, Direction=Vector(2, 0, 0), Count=2)  # -> Geometry, Transform; disabled
join_curves_22 = JoinCurves(Curves=linear_array.Geometry, Preserve=False)  # disabled
flip_curve = FlipCurve(Curve=join_curves_22)  # -> Curve, Flag; disabled
stream_filter_21 = StreamFilter(Gate=number_slider_21, Stream0=join_curves_22, Stream1=flip_curve.Curve)  # disabled
curve_domain = CurveDomain(Curve=stream_filter_21)  # -> Curve, Domain; disabled
deconstruct_domain_11 = DeconstructDomain(Domain=curve_domain.Domain)  # -> Start, End; disabled
construct_domain_2 = ConstructDomain(DomainStart=expr("X/8", deconstruct_domain_11.End), DomainEnd=expr("X*5/8", deconstruct_domain_11.End))  # disabled
sub_curve = SubCurve(BaseCurve=curve_domain.Curve, Domain=construct_domain_2)  # disabled
move_17 = Move(Geometry=sub_curve, Motion=Vector(-0.5, -0.5, 0))  # -> Geometry, Transform; disabled
scale_45 = Scale(Geometry=move_17.Geometry, Center=Point(0, 0, 0), Factor=0.5)  # -> Geometry, Transform; disabled
divide_curve_4 = DivideCurve(Curve=scale_45.Geometry, Count=number_23, Kinks=False)  # -> Points, Tangents, Parameters; disabled
deconstruct_24 = Deconstruct(Point=divide_curve_4.Points)  # -> simplify(graft(XComponent)), simplify(graft(YComponent)), ZComponent; disabled
expression_140 = Expression(X=deconstruct_24.XComponent, Expression="FORMAT(\"{0:R}\",X)")  # disabled
panel_226 = Panel(expression_140)  # disabled
expression_141 = Expression(Y=deconstruct_24.YComponent, Expression="FORMAT(\"{0:R}\",Y)")  # disabled
list_length_3 = ListLength(List=divide_curve_4.Points)  # disabled
duplicate_data_12 = DuplicateData(Data=";", Number=list_length_3, Order=True)  # -> simplify(graft(Data)); disabled
panel_227 = Panel(duplicate_data_12)  # disabled
panel_228 = Panel(expression_141)  # disabled
concatenate_2 = Concatenate(FragmentA=panel_226, FragmentB=panel_227, FragmentA_2=panel_228)  # -> flatten(Result); disabled
panel_229 = Panel(concatenate_2)  # disabled
txtwriter_3 = VBScript(filePath=file_path_3, data=flatten(panel_229), activate=button_2)  # -> out, A; inputs data: list; disabled; same code as txtwriter

end_points_15 = EndPoints(Curve=curve_96)  # -> Start, End
rectangle_2pt_15 = Rectangle2Pt(Plane=PlaneXY(0, 0, 0), PointA=end_points_15.Start, PointB=end_points_15.End, Radius=0)  # -> Rectangle, Length

number_24 = Number(number_5)

series_11 = Series(Start=0, Step=panel_89, Count=number_24)
expression_142 = Expression(O=series_11, Expression="FORMAT(\"{0:R}\",O)")  # disabled
panel_230 = Panel(expression_142)
bounds_10 = Bounds(Numbers=series_11)
expression_143 = Expression(X=number_24, Expression="1/X")
duplicate_data_13 = DuplicateData(Data=expression_143, Number=number_24, Order=True)

curve_graph_mapper_10 = CurveGraphMapper(Curves=curve_96, Rectangle=rectangle_2pt_15.Rectangle, Values=series_11, Flip=False, Snap=True, TextSize=0.015625)  # -> Mapped, GraphCurves, GraphPoints, ValueLines, ValuePoints, MappedLines, MappedPoints, Boundary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; disabled
graphmapper_10 = GraphMapper(Curve=curve_96, Boundary=rectangle_2pt_15.Rectangle, Numbers=series_11, Input=bounds_10, Output=bounds_10, bobo=True)
stream_filter_22 = StreamFilter(Gate=number_slider_25, Stream0=curve_graph_mapper_10.Mapped, Stream1=graphmapper_10)

turtle_11 = DotNETVBScriptLEGACY(Forward=duplicate_data_13, Left=stream_filter_22)  # -> Output, Points; inputs Forward: list, Left: list; same code as turtle

expression_144 = Expression(O=turtle_11.Points, Expression="FORMAT(\"{0:R}\",O)")
panel_231 = Panel(expression_144)

point_21 = Point(turtle_11.Points)
scale_46 = Scale(Geometry=point_21, Center=Point(0, 0, 0), Factor=expr("2^X", digit_scroller_90))  # -> Geometry, Transform

interpolate_t_11 = InterpolateT(Vertices=scale_46.Geometry, TangentStart=Vector(0.0625, 0, 0), TangentEnd=Vector(0, 0, 0), KnotStyle=2)  # -> Curve, Length, Domain
evaluate_length_42 = EvaluateLength(Curve=interpolate_t_11.Curve, Length=1, Normalized=True)  # -> Point, Tangent, Parameter
line_sdl_15 = LineSDL(Start=evaluate_length_42.Point, Direction=evaluate_length_42.Tangent, Length=1)
mirror_23 = Mirror(Geometry=interpolate_t_11.Curve, Plane=line_sdl_15)  # -> Geometry, Transform
join_curves_23 = JoinCurves(Curves=[interpolate_t_11.Curve, mirror_23.Geometry], Preserve=False)
evaluate_length_43 = EvaluateLength(Curve=join_curves_23, Length=1, Normalized=True)  # -> Point, Tangent, Parameter
rotate_12 = Rotate(Geometry=join_curves_23, Angle=3.141592654, Plane=evaluate_length_43.Point)  # -> Geometry, Transform
join_curves_24 = JoinCurves(Curves=[join_curves_23, rotate_12.Geometry], Preserve=False)
curve_107 = Curve(join_curves_24)

evaluate_length_44 = EvaluateLength(Curve=join_curves_24, Length=1, Normalized=True)  # -> Point, Tangent, Parameter
deconstruct_25 = Deconstruct(Point=evaluate_length_44.Point)  # -> XComponent, YComponent, ZComponent
expression_145 = Expression(O=deconstruct_25.YComponent, Expression="FORMAT(\"{0:R}\",O)")
expression_146 = Expression(O=deconstruct_25.XComponent, Expression="FORMAT(\"{0:R}\",O)")
expression_147 = Expression(O=deconstruct_25.ZComponent, Expression="FORMAT(\"{0:R}\",O)")
panel_232 = Panel(expression_145)
panel_233 = Panel(expression_146)
panel_234 = Panel(expression_147)
addition_11 = Addition(A=panel_232, B=panel_233)
expression_148 = Expression(O=addition_11, Expression="FORMAT(\"{0:R}\",O)")
panel_235 = Panel(expression_148)
division_21 = Division(A=panel_235, B=2)
expression_149 = Expression(O=division_21, Expression="FORMAT(\"{0:R}\",O)")
panel_236 = Panel(expression_149)
scale_47 = Scale(Geometry=scale_46.Geometry, Center=Point(0, 0, 0), Factor=expr("1/X", panel_236))  # -> Geometry, Transform
scale_48 = Scale(Geometry=curve_107, Center=Point(0, 0, 0), Factor=expr("1/X", panel_236))  # -> Geometry, Transform
evaluate_length_45 = EvaluateLength(Curve=scale_48.Geometry, Length=1, Normalized=True)  # -> Point, Tangent, Parameter
deconstruct_26 = Deconstruct(Point=evaluate_length_45.Point)  # -> XComponent, YComponent, ZComponent
expression_150 = Expression(O=deconstruct_26.YComponent, Expression="FORMAT(\"{0:R}\",O)")
expression_151 = Expression(O=deconstruct_26.XComponent, Expression="FORMAT(\"{0:R}\",O)")
expression_152 = Expression(O=deconstruct_26.ZComponent, Expression="FORMAT(\"{0:R}\",O)")
panel_237 = Panel(expression_150)
panel_238 = Panel(expression_151)
panel_239 = Panel(expression_152)
division_22 = Division(A=panel_233, B=panel_232)
expression_153 = Expression(O=division_22, Expression="FORMAT(\"{0:R}\",O)")
panel_240 = Panel(expression_153)
curve_108 = Curve(scale_48.Geometry)
point_22 = Point(scale_47.Geometry)

curve_109 = Curve(curve_108)

curve_110 = Curve(curve_109)
curve_domain_2 = CurveDomain(Curve=curve_110)  # -> Curve, Domain
deconstruct_domain_12 = DeconstructDomain(Domain=curve_domain_2.Domain)  # -> Start, End
construct_domain_3 = ConstructDomain(DomainStart=expr("X/2", deconstruct_domain_12.End), DomainEnd=deconstruct_domain_12.End)
sub_curve_2 = SubCurve(BaseCurve=curve_domain_2.Curve, Domain=construct_domain_3)
move_18 = Move(Geometry=sub_curve_2, Motion=Vector(-0.5, -0.5, 0))  # -> Geometry, Transform
scale_49 = Scale(Geometry=move_18.Geometry, Center=Point(0, 0, 0), Factor=2)  # -> Geometry, Transform
curve_111 = Curve(scale_49.Geometry)

scale_50 = Scale(Geometry=curve_111, Center=Point(0, 0, 0), Factor=0.5)  # -> Geometry, Transform
mirror_24 = Mirror(Geometry=scale_50.Geometry, Plane=yz_plane)  # -> Geometry, Transform
mirror_25 = Mirror(Geometry=[scale_50.Geometry, mirror_24.Geometry], Plane=xz_plane)  # -> Geometry, Transform
curve_112 = Curve([scale_50.Geometry, mirror_24.Geometry, mirror_25.Geometry])
curve_113 = Curve(graft(curve_112))

move_19 = Move(Geometry=curve_108, Motion=vector_xyz_8.Vector)  # -> Geometry, Transform
mirror_26 = Mirror(Geometry=curve_108, Plane=PlaneYZ(0, 0, 0))  # -> Geometry, Transform; disabled
curve_114 = Curve(move_19.Geometry)

digit_scroller_97 = DigitScroller(Scroller_Digits=12, Scroller_Prefix=" ", Scroller_Radix=1, Scroller_Value=0.0013733121)
panel_242 = Panel("256    0.001373312102167")

curve_115 = Curve(graft(curve_113))  # disabled
divide_curve_5 = DivideCurve(Curve=curve_115, Count=number_9, Kinks=False)  # -> Points, Tangents, Parameters
curvature = Curvature(Curve=curve_115, Parameter=divide_curve_5.Parameters)  # -> Point, Curvature, Curvature_2
deconstruct_arc = DeconstructArc(Arc=curvature.Curvature_2)  # -> BasePlane, Radius, Angle
expression_154 = Expression(O=deconstruct_arc.Radius, Expression="FORMAT(\"{0:R}\",O)")  # disabled
panel_244 = Panel(expression_154)
quick_graph = QuickGraph(deconstruct_arc.Radius, SortOrder=0)
one_over_x = OneOverX(Value=deconstruct_arc.Radius)

expression_155 = Expression(O=one_over_x, Expression="FORMAT(\"{0:R}\",O)")  # disabled
panel_245 = Panel(expression_155)

quick_graph_2 = QuickGraph(one_over_x, SortOrder=0)
multiplication = Multiplication(A=one_over_x, B=digit_scroller_40)
line_sdl_16 = LineSDL(Start=divide_curve.Points, Direction=Vector(0, 1, 0), Length=multiplication)

replace_nulls = ReplaceNulls(Items=one_over_x, Replacements=0)  # -> Items, Count
relative_differences = RelativeDifferences(Values=replace_nulls.Items)

curve_116 = Curve(line_sdl_16)

list_length_4 = ListLength(List=curve_115)  # -> flatten(Length)
mass_addition = MassAddition(Input=list_length_4)  # -> Result, PartialResults
panel_246 = Panel(mass_addition.Result)
series_12 = Series(Start=1, Step=1, Count=panel_246)  # -> graft(Series)
vector_xyz_11 = VectorXYZ(XComponent=expr("-X", series_12), YComponent=0, ZComponent=0)  # -> Vector, Length
move_20 = Move(Geometry=curve_116, Motion=vector_xyz_11.Vector)  # -> Geometry, Transform
evaluate_length_46 = EvaluateLength(Curve=move_20.Geometry, Length=1, Normalized=True)  # -> Point, Tangent, Parameter
interpolate = Interpolate(Vertices=evaluate_length_46.Point, Degree=1, Periodic=False, KnotStyle=2)  # -> Curve, Length, Domain

expression_156 = Expression(O=relative_differences, Expression="FORMAT(\"{0:R}\",O)")  # disabled
panel_247 = Panel(expression_156)
vector_xyz_12 = VectorXYZ(XComponent=expr("-X", series_12), YComponent=1, ZComponent=0)  # -> Vector, Length
quick_graph_3 = QuickGraph(relative_differences, SortOrder=0)
multiplication_2 = Multiplication(A=relative_differences, B=digit_scroller_42)
line_sdl_17 = LineSDL(Start=divide_curve.Points, Direction=Vector(0, 1, 0), Length=multiplication_2)
move_21 = Move(Geometry=line_sdl_17, Motion=vector_xyz_12.Vector)  # -> Geometry, Transform
evaluate_length_47 = EvaluateLength(Curve=move_21.Geometry, Length=1, Normalized=True)  # -> Point, Tangent, Parameter
interpolate_2 = Interpolate(Vertices=evaluate_length_47.Point, Degree=1, Periodic=False, KnotStyle=2)  # -> Curve, Length, Domain

vector_xyz_13 = VectorXYZ(XComponent=expr("-X", series_12), YComponent=2, ZComponent=0)  # -> Vector, Length
replace_nulls_2 = ReplaceNulls(Items=relative_differences, Replacements=0)  # -> Items, Count
relative_differences_2 = RelativeDifferences(Values=replace_nulls_2.Items)
expression_157 = Expression(O=relative_differences_2, Expression="FORMAT(\"{0:R}\",O)")  # disabled
panel_248 = Panel(expression_157)
quick_graph_4 = QuickGraph(relative_differences_2, SortOrder=0)
multiplication_3 = Multiplication(A=relative_differences_2, B=digit_scroller_39)
line_sdl_18 = LineSDL(Start=divide_curve.Points, Direction=Vector(0, 1, 0), Length=multiplication_3)
move_22 = Move(Geometry=line_sdl_18, Motion=vector_xyz_13.Vector)  # -> Geometry, Transform
evaluate_length_48 = EvaluateLength(Curve=move_22.Geometry, Length=1, Normalized=True)  # -> Point, Tangent, Parameter
interpolate_3 = Interpolate(Vertices=evaluate_length_48.Point, Degree=1, Periodic=False, KnotStyle=2)  # -> Curve, Length, Domain

vector_xyz_14 = VectorXYZ(XComponent=expr("-X", series_12), YComponent=3, ZComponent=0)  # -> Vector, Length
replace_nulls_3 = ReplaceNulls(Items=relative_differences_2, Replacements=0)  # -> Items, Count
relative_differences_3 = RelativeDifferences(Values=replace_nulls_3.Items)
expression_158 = Expression(O=relative_differences_3, Expression="FORMAT(\"{0:R}\",O)")  # disabled
panel_249 = Panel(expression_158)
quick_graph_5 = QuickGraph(relative_differences_3, SortOrder=0)
multiplication_4 = Multiplication(A=relative_differences_3, B=digit_scroller_38)
line_sdl_19 = LineSDL(Start=divide_curve.Points, Direction=Vector(0, 1, 0), Length=multiplication_4)  # disabled
move_23 = Move(Geometry=line_sdl_19, Motion=vector_xyz_14.Vector)  # -> Geometry, Transform
evaluate_length_49 = EvaluateLength(Curve=move_23.Geometry, Length=1, Normalized=True)  # -> Point, Tangent, Parameter
interpolate_4 = Interpolate(Vertices=evaluate_length_49.Point, Degree=1, Periodic=False, KnotStyle=2)  # -> Curve, Length, Domain

vector_xyz_15 = VectorXYZ(XComponent=expr("-X", series_12), YComponent=4, ZComponent=0)  # -> Vector, Length
replace_nulls_4 = ReplaceNulls(Items=relative_differences_3, Replacements=0)  # -> Items, Count
relative_differences_4 = RelativeDifferences(Values=replace_nulls_4.Items)
expression_159 = Expression(O=relative_differences_4, Expression="FORMAT(\"{0:R}\",O)")  # disabled
panel_250 = Panel(expression_159)
quick_graph_6 = QuickGraph(relative_differences_4, SortOrder=0)
multiplication_5 = Multiplication(A=relative_differences_4, B=digit_scroller_37)
line_sdl_20 = LineSDL(Start=divide_curve.Points, Direction=Vector(0, 1, 0), Length=multiplication_5)  # disabled
move_24 = Move(Geometry=line_sdl_20, Motion=vector_xyz_15.Vector)  # -> Geometry, Transform
evaluate_length_50 = EvaluateLength(Curve=move_24.Geometry, Length=1, Normalized=True)  # -> Point, Tangent, Parameter
interpolate_5 = Interpolate(Vertices=evaluate_length_50.Point, Degree=1, Periodic=False, KnotStyle=2)  # -> Curve, Length, Domain

vector_xyz_16 = VectorXYZ(XComponent=expr("-X", series_12), YComponent=5, ZComponent=0)  # -> Vector, Length
replace_nulls_5 = ReplaceNulls(Items=relative_differences_4, Replacements=0)  # -> Items, Count
relative_differences_5 = RelativeDifferences(Values=replace_nulls_5.Items)
expression_160 = Expression(O=relative_differences_5, Expression="FORMAT(\"{0:R}\",O)")  # disabled
panel_251 = Panel(expression_160)
quick_graph_7 = QuickGraph(relative_differences_5, SortOrder=0)
multiplication_6 = Multiplication(A=relative_differences_5, B=digit_scroller_43)
line_sdl_21 = LineSDL(Start=divide_curve.Points, Direction=Vector(0, 1, 0), Length=multiplication_6)  # disabled
move_25 = Move(Geometry=line_sdl_21, Motion=vector_xyz_16.Vector)  # -> Geometry, Transform
evaluate_length_51 = EvaluateLength(Curve=move_25.Geometry, Length=1, Normalized=True)  # -> Point, Tangent, Parameter
interpolate_6 = Interpolate(Vertices=evaluate_length_51.Point, Degree=1, Periodic=False, KnotStyle=2)  # -> Curve, Length, Domain

replace_nulls_6 = ReplaceNulls(Items=relative_differences_5, Replacements=0)  # -> Items, Count
relative_differences_6 = RelativeDifferences(Values=replace_nulls_6.Items)

expression_161 = Expression(O=relative_differences_6, Expression="FORMAT(\"{0:R}\",O)")  # disabled
panel_252 = Panel(expression_161)
vector_xyz_17 = VectorXYZ(XComponent=expr("-X", series_12), YComponent=6, ZComponent=0)  # -> Vector, Length
quick_graph_8 = QuickGraph(relative_differences_6, SortOrder=0)
multiplication_7 = Multiplication(A=relative_differences_6, B=digit_scroller_44)
line_sdl_22 = LineSDL(Start=divide_curve.Points, Direction=Vector(0, 1, 0), Length=multiplication_7)  # disabled
move_26 = Move(Geometry=line_sdl_22, Motion=vector_xyz_17.Vector)  # -> Geometry, Transform
evaluate_length_52 = EvaluateLength(Curve=move_26.Geometry, Length=1, Normalized=True)  # -> Point, Tangent, Parameter
interpolate_7 = Interpolate(Vertices=evaluate_length_52.Point, Degree=1, Periodic=False, KnotStyle=2)  # -> Curve, Length, Domain

vector_xyz_18 = VectorXYZ(XComponent=expr("-X", series_12), YComponent=7, ZComponent=0)  # -> Vector, Length
replace_nulls_7 = ReplaceNulls(Items=relative_differences_6, Replacements=0)  # -> Items, Count
relative_differences_7 = RelativeDifferences(Values=replace_nulls_7.Items)
expression_162 = Expression(O=relative_differences_7, Expression="FORMAT(\"{0:R}\",O)")  # disabled
panel_253 = Panel(expression_162)
quick_graph_9 = QuickGraph(relative_differences_7, SortOrder=0)
multiplication_8 = Multiplication(A=relative_differences_7, B=digit_scroller_41)
line_sdl_23 = LineSDL(Start=divide_curve.Points, Direction=Vector(0, 1, 0), Length=multiplication_8)  # disabled
move_27 = Move(Geometry=line_sdl_23, Motion=vector_xyz_18.Vector)  # -> Geometry, Transform
evaluate_length_53 = EvaluateLength(Curve=move_27.Geometry, Length=1, Normalized=True)  # -> Point, Tangent, Parameter
interpolate_8 = Interpolate(Vertices=evaluate_length_53.Point, Degree=1, Periodic=False, KnotStyle=2)  # -> Curve, Length, Domain

vector_xyz_19 = VectorXYZ(XComponent=expr("-X", series_12), YComponent=8, ZComponent=0)  # -> Vector, Length
replace_nulls_8 = ReplaceNulls(Items=relative_differences_7, Replacements=0)  # -> Items, Count
relative_differences_8 = RelativeDifferences(Values=replace_nulls_8.Items)
expression_163 = Expression(O=relative_differences_8, Expression="FORMAT(\"{0:R}\",O)")  # disabled
panel_254 = Panel(expression_163)
quick_graph_10 = QuickGraph(relative_differences_8, SortOrder=0)
multiplication_9 = Multiplication(A=relative_differences_8, B=digit_scroller_45)
line_sdl_24 = LineSDL(Start=divide_curve.Points, Direction=Vector(0, 1, 0), Length=multiplication_9)  # disabled
move_28 = Move(Geometry=line_sdl_24, Motion=vector_xyz_19.Vector)  # -> Geometry, Transform
evaluate_length_54 = EvaluateLength(Curve=move_28.Geometry, Length=1, Normalized=True)  # -> Point, Tangent, Parameter
interpolate_9 = Interpolate(Vertices=evaluate_length_54.Point, Degree=1, Periodic=False, KnotStyle=2)  # -> Curve, Length, Domain

custom_preview = CustomPreview(Geometry=interpolate_5.Curve, Material=create_material)

custom_preview_2 = CustomPreview(Geometry=move_24.Geometry, Material=create_material_2)

custom_preview_3 = CustomPreview(Geometry=interpolate_4.Curve, Material=create_material_3)

custom_preview_4 = CustomPreview(Geometry=move_23.Geometry, Material=create_material_4)

custom_preview_5 = CustomPreview(Geometry=interpolate_3.Curve, Material=create_material_5)

custom_preview_6 = CustomPreview(Geometry=move_22.Geometry, Material=create_material_6)

custom_preview_7 = CustomPreview(Geometry=interpolate_2.Curve, Material=create_material_7)

custom_preview_8 = CustomPreview(Geometry=move_21.Geometry, Material=create_material_8)

custom_preview_9 = CustomPreview(Geometry=interpolate.Curve, Material=create_material_9)

custom_preview_10 = CustomPreview(Geometry=move_20.Geometry, Material=create_material_10)

custom_preview_11 = CustomPreview(Geometry=interpolate_9.Curve, Material=create_material_11)

custom_preview_12 = CustomPreview(Geometry=move_28.Geometry, Material=create_material_12)

custom_preview_13 = CustomPreview(Geometry=interpolate_8.Curve, Material=create_material_13)

custom_preview_14 = CustomPreview(Geometry=move_27.Geometry, Material=create_material_14)

custom_preview_15 = CustomPreview(Geometry=interpolate_6.Curve, Material=create_material_15)

custom_preview_16 = CustomPreview(Geometry=move_25.Geometry, Material=create_material_16)

custom_preview_17 = CustomPreview(Geometry=interpolate_7.Curve, Material=create_material_17)

custom_preview_18 = CustomPreview(Geometry=move_26.Geometry, Material=create_material_18)

curve_117 = Curve(graft(curve_113))
divide_curve_6 = DivideCurve(Curve=curve_117, Count=number_12, Kinks=False)  # -> Points, Tangents, Parameters
curvature_2 = Curvature(Curve=curve_117, Parameter=divide_curve_6.Parameters)  # -> Point, Curvature, Curvature_2
deconstruct_arc_2 = DeconstructArc(Arc=curvature_2.Curvature_2)  # -> BasePlane, Radius, Angle
line = Line(StartPoint=curvature_2.Point, EndPoint=deconstruct_arc_2.BasePlane)
one_over_x_2 = OneOverX(Value=deconstruct_arc_2.Radius)
quick_graph_11 = QuickGraph(one_over_x_2, SortOrder=0)
replace_nulls_9 = ReplaceNulls(Items=one_over_x_2, Replacements=0)  # -> Items, Count
relative_differences_9 = RelativeDifferences(Values=replace_nulls_9.Items)
curvature_graph = CurvatureGraph(Curve=curve_117, Density=1, Scale=digit_scroller_60)  # disabled
custom_preview_19 = CustomPreview(Geometry=curve_117, Material=create_material_21)

expression_164 = Expression(O=relative_differences_9, Expression="FORMAT(\"{0:R}\",O)")  # disabled
panel_255 = Panel(expression_164)
quick_graph_12 = QuickGraph(relative_differences_9, SortOrder=0)

expression_165 = Expression(O=one_over_x_2, Expression="FORMAT(\"{0:R}\",O)")  # disabled
panel_256 = Panel(expression_165)

expression_166 = Expression(O=deconstruct_arc_2.Radius, Expression="FORMAT(\"{0:R}\",O)")  # disabled
panel_257 = Panel(expression_166)

derivatives = Derivatives(Curve=curve_117, Parameter=divide_curve_6.Parameters)  # -> Point, FirstDerivative, SecondDerivative, ThirdDerivative, FourthDerivative, FifthDerivative, SixthDerivative; disabled
quick_graph_13 = QuickGraph(derivatives.SixthDerivative, SortOrder=0)
quick_graph_14 = QuickGraph(derivatives.FifthDerivative, SortOrder=0)
quick_graph_15 = QuickGraph(derivatives.FourthDerivative, SortOrder=0)
quick_graph_16 = QuickGraph(derivatives.ThirdDerivative, SortOrder=0)
quick_graph_17 = QuickGraph(derivatives.SecondDerivative, SortOrder=0)
quick_graph_18 = QuickGraph(derivatives.FirstDerivative, SortOrder=0)
quick_graph_19 = QuickGraph(derivatives.Point, SortOrder=0)
length = Length(Curve=curve_117)

relative_differences_10 = RelativeDifferences(Values=relative_differences_9)

quick_graph_20 = QuickGraph(relative_differences_10, SortOrder=0)
bounds_11 = Bounds(Numbers=relative_differences_10)
remap_numbers = RemapNumbers(Value=relative_differences_10, Source=bounds_11, Target=Domain(-1, 1))  # -> Mapped, Clipped
multiplication_10 = Multiplication(A=remap_numbers.Mapped, B=length)
multiplication_11 = Multiplication(A=multiplication_10, B=digit_scroller_61)

relative_differences_11 = RelativeDifferences(Values=relative_differences_10)

quick_graph_21 = QuickGraph(relative_differences_11, SortOrder=0)

relative_differences_12 = RelativeDifferences(Values=relative_differences_11)

quick_graph_22 = QuickGraph(relative_differences_12, SortOrder=0)
bounds_12 = Bounds(Numbers=relative_differences_12)
remap_numbers_2 = RemapNumbers(Value=relative_differences_12, Source=bounds_12, Target=Domain(-1, 1))  # -> Mapped, Clipped
multiplication_12 = Multiplication(A=remap_numbers_2.Mapped, B=length)
multiplication_13 = Multiplication(A=multiplication_12, B=digit_scroller_5)

relative_differences_13 = RelativeDifferences(Values=relative_differences_12)

relative_differences_14 = RelativeDifferences(Values=relative_differences_13)

quick_graph_23 = QuickGraph(relative_differences_14, SortOrder=0)
bounds_13 = Bounds(Numbers=relative_differences_14)
remap_numbers_3 = RemapNumbers(Value=relative_differences_14, Source=bounds_13, Target=Domain(-1, 1))  # -> Mapped, Clipped
multiplication_14 = Multiplication(A=remap_numbers_3.Mapped, B=length)
multiplication_15 = Multiplication(A=multiplication_14, B=digit_scroller_4)

relative_differences_15 = RelativeDifferences(Values=relative_differences_14)

quick_graph_24 = QuickGraph(relative_differences_15, SortOrder=0)
bounds_14 = Bounds(Numbers=relative_differences_15)
remap_numbers_4 = RemapNumbers(Value=relative_differences_15, Source=bounds_14, Target=Domain(-1, 1))  # -> Mapped, Clipped
multiplication_16 = Multiplication(A=remap_numbers_4.Mapped, B=length)
multiplication_17 = Multiplication(A=multiplication_16, B=digit_scroller_56)

relative_differences_16 = RelativeDifferences(Values=relative_differences_15)

quick_graph_25 = QuickGraph(relative_differences_16, SortOrder=0)
bounds_15 = Bounds(Numbers=relative_differences_16)
remap_numbers_5 = RemapNumbers(Value=relative_differences_16, Source=bounds_15, Target=Domain(-1, 1))  # -> Mapped, Clipped
multiplication_18 = Multiplication(A=remap_numbers_5.Mapped, B=length)
multiplication_19 = Multiplication(A=multiplication_18, B=digit_scroller_3)

quick_graph_26 = QuickGraph(relative_differences_13, SortOrder=0)
bounds_16 = Bounds(Numbers=relative_differences_13)
remap_numbers_6 = RemapNumbers(Value=relative_differences_13, Source=bounds_16, Target=Domain(-1, 1))  # -> Mapped, Clipped
multiplication_20 = Multiplication(A=remap_numbers_6.Mapped, B=length)
multiplication_21 = Multiplication(A=multiplication_20, B=digit_scroller_6)

bounds_17 = Bounds(Numbers=relative_differences_11)
remap_numbers_7 = RemapNumbers(Value=relative_differences_11, Source=bounds_17, Target=Domain(-1, 1))  # -> Mapped, Clipped

bounds_18 = Bounds(Numbers=relative_differences_9)
remap_numbers_8 = RemapNumbers(Value=relative_differences_9, Source=bounds_18, Target=Domain(-1, 1))  # -> Mapped, Clipped

bounds_19 = Bounds(Numbers=one_over_x_2)
remap_numbers_9 = RemapNumbers(Value=one_over_x_2, Source=bounds_19, Target=Domain(0, 1))  # -> Mapped, Clipped

multiplication_22 = Multiplication(A=remap_numbers_7.Mapped, B=length)

multiplication_23 = Multiplication(A=multiplication_22, B=digit_scroller_58)

multiplication_24 = Multiplication(A=remap_numbers_8.Mapped, B=length)
multiplication_25 = Multiplication(A=length, B=remap_numbers_9.Mapped)

multiplication_26 = Multiplication(A=multiplication_24, B=digit_scroller_62)

multiplication_27 = Multiplication(A=multiplication_25, B=digit_scroller_57)

line_sdl_25 = LineSDL(Start=curvature_2.Point, Direction=line, Length=expr("-X", multiplication_27))
evaluate_length_55 = EvaluateLength(Curve=line_sdl_25, Length=1, Normalized=True)  # -> Point, Tangent, Parameter
interpolate_10 = Interpolate(Vertices=evaluate_length_55.Point, Degree=3, Periodic=False, KnotStyle=2)  # -> Curve, Length, Domain
custom_preview_20 = CustomPreview(Geometry=line_sdl_25, Material=create_material_20)
curve_118 = Curve(interpolate_10.Curve)
custom_preview_21 = CustomPreview(Geometry=curve_118, Material=create_material_19)

line_sdl_26 = LineSDL(Start=evaluate_length_55.Point, Direction=line_sdl_25, Length=expr("ABS(X)", multiplication_26))
nurbs_curve = NurbsCurve(Vertices=evaluate_length_55.Point, Degree=3, Periodic=False)  # -> Curve, Length, Domain; disabled
custom_preview_22 = CustomPreview(Geometry=line_sdl_26, Material=create_material_25)
curve_119 = Curve(line_sdl_26)
evaluate_length_56 = EvaluateLength(Curve=curve_119, Length=1, Normalized=True)  # -> Point, Tangent, Parameter
line_sdl_27 = LineSDL(Start=evaluate_length_56.Point, Direction=derivatives.ThirdDerivative, Length=expr("-X", multiplication_26))
evaluate_length_57 = EvaluateLength(Curve=line_sdl_27, Length=1, Normalized=True)  # -> Point, Tangent, Parameter
interpolate_11 = Interpolate(Vertices=evaluate_length_57.Point, Degree=3, Periodic=False, KnotStyle=2)  # -> Curve, Length, Domain
custom_preview_23 = CustomPreview(Geometry=interpolate_11.Curve, Material=create_material_22)
custom_preview_24 = CustomPreview(Geometry=line_sdl_27, Material=create_material_23)
interpolate_12 = Interpolate(Vertices=evaluate_length_56.Point, Degree=3, Periodic=False, KnotStyle=2)  # -> Curve, Length, Domain
polyline = PolyLine(Vertices=evaluate_length_56.Point, Closed=False)
explode = Explode(Curve=polyline, Recursive=True)  # -> Segments, Vertices
custom_preview_25 = CustomPreview(Geometry=interpolate_12.Curve, Material=create_material_24)
curve_120 = Curve(flatten(explode.Segments))
length_2 = Length(Curve=curve_120)
sort_list = SortList(Keys=length_2, ValuesValuesA=curve_120)  # -> Keys, ValuesValuesA
list_item_2 = ListItem(List=sort_list.Keys, Index=0, Wrap=False)
dot_display = DotDisplay(Point=evaluate_length_56.Point, Colour=RGB(194, 194, 194), Size=expr("X/2", list_item_2))

expression_167 = Expression(O=sort_list.Keys, Expression="FORMAT(\"{0:R}\",O)")  # disabled
panel_258 = Panel(expression_167)

line_sdl_28 = LineSDL(Start=evaluate_length_56.Point, Direction=line_sdl_25, Length=expr("ABS(X)", multiplication_11))

evaluate_length_58 = EvaluateLength(Curve=line_sdl_28, Length=1, Normalized=True)  # -> Point, Tangent, Parameter
interpolate_13 = Interpolate(Vertices=evaluate_length_58.Point, Degree=3, Periodic=False, KnotStyle=2)  # -> Curve, Length, Domain
custom_preview_26 = CustomPreview(Geometry=interpolate_13.Curve, Material=create_material_38)
custom_preview_27 = CustomPreview(Geometry=line_sdl_28, Material=create_material_39)

line_sdl_29 = LineSDL(Start=evaluate_length_58.Point, Direction=line_sdl_25, Length=expr("ABS(X)", multiplication_23))  # disabled

evaluate_length_59 = EvaluateLength(Curve=line_sdl_29, Length=1, Normalized=True)  # -> Point, Tangent, Parameter
interpolate_14 = Interpolate(Vertices=evaluate_length_59.Point, Degree=1, Periodic=False, KnotStyle=2)  # -> Curve, Length, Domain
custom_preview_28 = CustomPreview(Geometry=interpolate_14.Curve, Material=create_material_36)
custom_preview_29 = CustomPreview(Geometry=line_sdl_29, Material=create_material_37)

line_sdl_30 = LineSDL(Start=evaluate_length_59.Point, Direction=line_sdl_25, Length=expr("ABS(X)", multiplication_13))  # disabled

evaluate_length_60 = EvaluateLength(Curve=line_sdl_30, Length=1, Normalized=True)  # -> Point, Tangent, Parameter
interpolate_15 = Interpolate(Vertices=evaluate_length_60.Point, Degree=1, Periodic=False, KnotStyle=2)  # -> Curve, Length, Domain
custom_preview_30 = CustomPreview(Geometry=interpolate_15.Curve, Material=create_material_34)
custom_preview_31 = CustomPreview(Geometry=line_sdl_30, Material=create_material_35)

line_sdl_31 = LineSDL(Start=evaluate_length_60.Point, Direction=line_sdl_25, Length=expr("ABS(X)", multiplication_21))  # disabled

evaluate_length_61 = EvaluateLength(Curve=line_sdl_31, Length=1, Normalized=True)  # -> Point, Tangent, Parameter
interpolate_16 = Interpolate(Vertices=evaluate_length_61.Point, Degree=1, Periodic=False, KnotStyle=2)  # -> Curve, Length, Domain
custom_preview_32 = CustomPreview(Geometry=interpolate_16.Curve, Material=create_material_32)
custom_preview_33 = CustomPreview(Geometry=line_sdl_31, Material=create_material_33)

line_sdl_32 = LineSDL(Start=evaluate_length_61.Point, Direction=line_sdl_25, Length=expr("ABS(X)", multiplication_15))

evaluate_length_62 = EvaluateLength(Curve=line_sdl_32, Length=1, Normalized=True)  # -> Point, Tangent, Parameter
interpolate_17 = Interpolate(Vertices=evaluate_length_62.Point, Degree=1, Periodic=False, KnotStyle=2)  # -> Curve, Length, Domain
custom_preview_34 = CustomPreview(Geometry=interpolate_17.Curve, Material=create_material_30)
custom_preview_35 = CustomPreview(Geometry=line_sdl_32, Material=create_material_31)

line_sdl_33 = LineSDL(Start=evaluate_length_62.Point, Direction=line_sdl_25, Length=expr("ABS(X)", multiplication_17))

evaluate_length_63 = EvaluateLength(Curve=line_sdl_33, Length=1, Normalized=True)  # -> Point, Tangent, Parameter
interpolate_18 = Interpolate(Vertices=evaluate_length_63.Point, Degree=1, Periodic=False, KnotStyle=2)  # -> Curve, Length, Domain
custom_preview_36 = CustomPreview(Geometry=interpolate_18.Curve, Material=create_material_28)
custom_preview_37 = CustomPreview(Geometry=line_sdl_33, Material=create_material_29)

line_sdl_34 = LineSDL(Start=evaluate_length_63.Point, Direction=line_sdl_25, Length=expr("ABS(X)", multiplication_19))  # disabled

evaluate_length_64 = EvaluateLength(Curve=line_sdl_34, Length=1, Normalized=True)  # -> Point, Tangent, Parameter
interpolate_19 = Interpolate(Vertices=evaluate_length_64.Point, Degree=1, Periodic=False, KnotStyle=2)  # -> Curve, Length, Domain
custom_preview_38 = CustomPreview(Geometry=interpolate_19.Curve, Material=create_material_26)
custom_preview_39 = CustomPreview(Geometry=line_sdl_34, Material=create_material_27)

length_3 = Length(Curve=line_sdl_25)
sort_list_2 = SortList(Keys=length_3, ValuesA=line_sdl_25)  # -> reverse(flatten(Keys)), reverse(flatten(ValuesA))
list_item_3 = ListItem(List=sort_list_2.Keys, Index=0, Wrap=False)
panel_259 = Panel(list_item_3)

length_4 = Length(Curve=line_sdl_28)
sort_list_3 = SortList(Keys=length_4, ValuesValuesA=line_sdl_28)  # -> reverse(flatten(Keys)), reverse(flatten(ValuesValuesA))
list_item_4 = ListItem(List=sort_list_3.Keys, Index=0, Wrap=False)
panel_260 = Panel(list_item_4)
division_23 = Division(A=list_item_3, B=list_item_4)
expression_168 = Expression(X=division_23, Expression="FORMAT(\"{0:R}\",X)")  # -> simplify(Result)
panel_261 = Panel(expression_168)

curve_121 = Curve(interpolate_13.Curve)  # disabled
curve_122 = Curve(interpolate_12.Curve)  # disabled
evaluate_length_65 = EvaluateLength(Curve=curve_122, Length=[0.0625, 0.1875, 0.3125, 0.4375, 0.5625, 0.6875, 0.8125, 0.9375], Normalized=True)  # -> Point, Tangent, Parameter; disabled
circle_tantan = CircleTanTan(CurveA=curve_122, CurveB=curve_121, Point=evaluate_length_65.Point)  # disabled

curve_123 = Curve(interpolate_12.Curve)  # disabled
curve_124 = Curve(interpolate_10.Curve)  # disabled
evaluate_length_66 = EvaluateLength(Curve=curve_124, Length=[0.125, 0.375, 0.625, 0.875], Normalized=True)  # -> Point, Tangent, Parameter; disabled
circle_tantan_2 = CircleTanTan(CurveA=curve_124, CurveB=curve_123, Point=evaluate_length_66.Point)  # disabled

curve_125 = Curve(curve_117)  # disabled
curve_126 = Curve(interpolate_10.Curve)  # disabled
evaluate_length_67 = EvaluateLength(Curve=curve_126, Length=[0.25, 0.75], Normalized=True)  # -> Point, Tangent, Parameter; disabled
circle_tantan_3 = CircleTanTan(CurveA=curve_126, CurveB=curve_125, Point=evaluate_length_67.Point)  # disabled

radians_12 = Radians(Degrees=number_3)

expression_169 = Expression(O=radians_12, Expression="FORMAT(\"{0:0.00000000000000000000}\",O)")
panel_262 = Panel(expression_169)
number_25 = Number(number_5)

end_points_16 = EndPoints(Curve=curve_98)  # -> Start, End
rectangle_2pt_16 = Rectangle2Pt(Plane=PlaneXY(0, 0, 0), PointA=end_points_16.Start, PointB=end_points_16.End, Radius=0)  # -> Rectangle, Length

series_13 = Series(Start=0, Step=panel_262, Count=number_25)
expression_170 = Expression(O=series_13, Expression="FORMAT(\"{0:R}\",O)")  # disabled
panel_263 = Panel(expression_170)
bounds_20 = Bounds(Numbers=series_13)
expression_171 = Expression(X=number_25, Expression="1/X")
duplicate_data_14 = DuplicateData(Data=expression_171, Number=number_25, Order=True)

curve_graph_mapper_11 = CurveGraphMapper(Curves=curve_98, Rectangle=rectangle_2pt_16.Rectangle, Values=series_13, Flip=False, Snap=True, TextSize=0.015625)  # -> Mapped, GraphCurves, GraphPoints, ValueLines, ValuePoints, MappedLines, MappedPoints, Boundary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; disabled
graphmapper_11 = GraphMapper(Curve=curve_98, Boundary=rectangle_2pt_16.Rectangle, Numbers=series_13, Input=bounds_20, Output=bounds_20, bobo=False)  # disabled
stream_filter_23 = StreamFilter(Gate=number_slider_25, Stream0=curve_graph_mapper_11.Mapped, Stream1=graphmapper_11)

turtle_12 = DotNETVBScriptLEGACY(Forward=duplicate_data_14, Left=stream_filter_23)  # -> Output, Points; inputs Forward: list, Left: list; same code as turtle

expression_172 = Expression(O=turtle_12.Points, Expression="FORMAT(\"{0:R}\",O)")
panel_264 = Panel(expression_172)

point_23 = Point(turtle_12.Points)
scale_51 = Scale(Geometry=point_23, Center=Point(0, 0, 0), Factor=expr("2^X", digit_scroller_94))  # -> Geometry, Transform

interpolate_t_12 = InterpolateT(Vertices=scale_51.Geometry, TangentStart=Vector(0.0625, 0, 0), TangentEnd=Vector(0, 0, 0), KnotStyle=2)  # -> Curve, Length, Domain
evaluate_length_68 = EvaluateLength(Curve=interpolate_t_12.Curve, Length=1, Normalized=True)  # -> Point, Tangent, Parameter
line_sdl_35 = LineSDL(Start=evaluate_length_68.Point, Direction=evaluate_length_68.Tangent, Length=1)
mirror_27 = Mirror(Geometry=interpolate_t_12.Curve, Plane=line_sdl_35)  # -> Geometry, Transform
join_curves_25 = JoinCurves(Curves=[interpolate_t_12.Curve, mirror_27.Geometry], Preserve=False)
evaluate_length_69 = EvaluateLength(Curve=join_curves_25, Length=1, Normalized=True)  # -> Point, Tangent, Parameter
rotate_13 = Rotate(Geometry=join_curves_25, Angle=3.141592654, Plane=evaluate_length_69.Point)  # -> Geometry, Transform
join_curves_26 = JoinCurves(Curves=[join_curves_25, rotate_13.Geometry], Preserve=False)
curve_127 = Curve(join_curves_26)

evaluate_length_70 = EvaluateLength(Curve=join_curves_26, Length=1, Normalized=True)  # -> Point, Tangent, Parameter
deconstruct_27 = Deconstruct(Point=evaluate_length_70.Point)  # -> XComponent, YComponent, ZComponent
expression_173 = Expression(O=deconstruct_27.YComponent, Expression="FORMAT(\"{0:R}\",O)")
expression_174 = Expression(O=deconstruct_27.XComponent, Expression="FORMAT(\"{0:R}\",O)")
expression_175 = Expression(O=deconstruct_27.ZComponent, Expression="FORMAT(\"{0:R}\",O)")
panel_265 = Panel(expression_173)
panel_266 = Panel(expression_174)
panel_267 = Panel(expression_175)
addition_12 = Addition(A=panel_265, B=panel_266)
expression_176 = Expression(O=addition_12, Expression="FORMAT(\"{0:R}\",O)")
panel_268 = Panel(expression_176)
division_24 = Division(A=panel_268, B=2)
expression_177 = Expression(O=division_24, Expression="FORMAT(\"{0:R}\",O)")
panel_269 = Panel(expression_177)
scale_52 = Scale(Geometry=scale_51.Geometry, Center=Point(0, 0, 0), Factor=expr("1/X", panel_269))  # -> Geometry, Transform
scale_53 = Scale(Geometry=curve_127, Center=Point(0, 0, 0), Factor=expr("1/X", panel_269))  # -> Geometry, Transform
evaluate_length_71 = EvaluateLength(Curve=scale_53.Geometry, Length=1, Normalized=True)  # -> Point, Tangent, Parameter
deconstruct_28 = Deconstruct(Point=evaluate_length_71.Point)  # -> XComponent, YComponent, ZComponent
expression_178 = Expression(O=deconstruct_28.YComponent, Expression="FORMAT(\"{0:R}\",O)")
expression_179 = Expression(O=deconstruct_28.XComponent, Expression="FORMAT(\"{0:R}\",O)")
expression_180 = Expression(O=deconstruct_28.ZComponent, Expression="FORMAT(\"{0:R}\",O)")
panel_270 = Panel(expression_178)
panel_271 = Panel(expression_179)
panel_272 = Panel(expression_180)
division_25 = Division(A=panel_266, B=panel_265)
expression_181 = Expression(O=division_25, Expression="FORMAT(\"{0:R}\",O)")
panel_273 = Panel(expression_181)
curve_128 = Curve(scale_53.Geometry)
point_24 = Point(scale_52.Geometry)

move_29 = Move(Geometry=curve_128, Motion=Vector(12.5, 0, 0))  # -> Geometry, Transform
mirror_28 = Mirror(Geometry=curve_128, Plane=PlaneYZ(0, 0, 0))  # -> Geometry, Transform; disabled
curve_129 = Curve(move_29.Geometry)

curve_130 = Curve(curve_128)
end_points_17 = EndPoints(Curve=curve_130)  # -> Start, End
rectangle_2pt_17 = Rectangle2Pt(Plane=PlaneXY(0, 0, 0), PointA=end_points_17.Start, PointB=end_points_17.End, Radius=0)  # -> Rectangle, Length
deconstuct_rectangle_6 = DeconstuctRectangle(Rectangle=rectangle_2pt_17.Rectangle)  # -> BasePlane, XInterval, YInterval
deconstruct_domain_13 = DeconstructDomain(Domain=deconstuct_rectangle_6.YInterval)  # -> Start, End
deconstruct_domain_14 = DeconstructDomain(Domain=deconstuct_rectangle_6.XInterval)  # -> Start, End
scale_nu_6 = ScaleNU(
    Geometry=curve_128,
    Plane=PlaneXY(0, 0, 0),
    ScaleX=expr("1/X", deconstruct_domain_14.End),
    ScaleY=expr("1/X", deconstruct_domain_13.End),
    ScaleZ=1)  # -> Geometry, Transform
curve_131 = Curve(scale_nu_6.Geometry)
move_30 = Move(Geometry=curve_131, Motion=vector_xyz_10.Vector)  # -> Geometry, Transform
curve_132 = Curve(move_30.Geometry)

digit_scroller_98 = DigitScroller(Scroller_Digits=12, Scroller_Prefix=" ", Scroller_Radix=2, Scroller_Value=0)
stream_filter_24 = StreamFilter(Gate=number_slider_24, Stream0=curve_128, Stream1=curve_131)
curve_133 = Curve(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)
curve_134 = Curve(stream_filter_24)
scale_54 = Scale(Geometry=curve_134, Center=Point(0, 0, 0), Factor=expr("2^X", number))  # -> Geometry, Transform
curve_135 = Curve(scale_54.Geometry)
curve_136 = Curve(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)

digit_scroller_99 = DigitScroller(Scroller_Digits=12, Scroller_Prefix="Digit Scroller", Scroller_Radix=1, Scroller_Value=0.00140149998)
number_slider_26 = Slider(256, range=0..65536)
radians_13 = Radians(Degrees=number_3)

expression_182 = Expression(O=radians_13, Expression="FORMAT(\"{0:0.00000000000000000000}\",O)")
panel_279 = Panel(expression_182)
curve_137 = Curve(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)
number_26 = Number(number_5)

digit_scroller_100 = DigitScroller(Scroller_Digits=12, Scroller_Prefix=" ", Scroller_Radix=7, Scroller_Value=16)

number_slider_27 = Slider(1, range=0..1)
end_points_18 = EndPoints(Curve=curve_135)  # -> Start, End
rectangle_2pt_18 = Rectangle2Pt(Plane=PlaneXY(0, 0, 0), PointA=end_points_18.Start, PointB=end_points_18.End, Radius=0)  # -> Rectangle, Length

series_14 = Series(Start=0, Step=panel_279, Count=number_26)
expression_183 = Expression(O=series_14, Expression="FORMAT(\"{0:R}\",O)")  # disabled
panel_280 = Panel(expression_183)
bounds_21 = Bounds(Numbers=series_14)
expression_184 = Expression(X=number_26, Expression="1/X")
duplicate_data_15 = DuplicateData(Data=expression_184, Number=number_26, Order=True)

curve_graph_mapper_12 = CurveGraphMapper(Curves=curve_135, Rectangle=rectangle_2pt_18.Rectangle, Values=series_14, Flip=False, Snap=True, TextSize=0.015625)  # -> Mapped, GraphCurves, GraphPoints, ValueLines, ValuePoints, MappedLines, MappedPoints, Boundary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; disabled
graphmapper_12 = GraphMapper(Curve=curve_135, Boundary=rectangle_2pt_18.Rectangle, Numbers=series_14, Input=bounds_21, Output=bounds_21, bobo=False)
stream_filter_25 = StreamFilter(Gate=number_slider_25, Stream0=curve_graph_mapper_12.Mapped, Stream1=graphmapper_12)

turtle_13 = DotNETVBScriptLEGACY(Forward=duplicate_data_15, Left=stream_filter_25)  # -> Output, Points; inputs Forward: list, Left: list; same code as turtle

expression_185 = Expression(O=turtle_13.Points, Expression="FORMAT(\"{0:R}\",O)")
panel_281 = Panel(expression_185)

point_25 = Point(turtle_13.Points)
scale_55 = Scale(Geometry=point_25, Center=Point(0, 0, 0), Factor=expr("2^X", digit_scroller_100))  # -> Geometry, Transform

interpolate_t_13 = InterpolateT(Vertices=scale_55.Geometry, TangentStart=Vector(0.0625, 0, 0), TangentEnd=Vector(0, 0, 0), KnotStyle=2)  # -> Curve, Length, Domain
evaluate_length_72 = EvaluateLength(Curve=interpolate_t_13.Curve, Length=1, Normalized=True)  # -> Point, Tangent, Parameter
line_sdl_36 = LineSDL(Start=evaluate_length_72.Point, Direction=evaluate_length_72.Tangent, Length=1)
mirror_29 = Mirror(Geometry=interpolate_t_13.Curve, Plane=line_sdl_36)  # -> Geometry, Transform
join_curves_27 = JoinCurves(Curves=[interpolate_t_13.Curve, mirror_29.Geometry], Preserve=False)
evaluate_length_73 = EvaluateLength(Curve=join_curves_27, Length=1, Normalized=True)  # -> Point, Tangent, Parameter
rotate_14 = Rotate(Geometry=join_curves_27, Angle=3.141592654, Plane=evaluate_length_73.Point)  # -> Geometry, Transform
join_curves_28 = JoinCurves(Curves=[join_curves_27, rotate_14.Geometry], Preserve=False)
curve_138 = Curve(join_curves_28)

evaluate_length_74 = EvaluateLength(Curve=join_curves_28, Length=1, Normalized=True)  # -> Point, Tangent, Parameter
deconstruct_29 = Deconstruct(Point=evaluate_length_74.Point)  # -> XComponent, YComponent, ZComponent
expression_186 = Expression(O=deconstruct_29.YComponent, Expression="FORMAT(\"{0:R}\",O)")
expression_187 = Expression(O=deconstruct_29.XComponent, Expression="FORMAT(\"{0:R}\",O)")
expression_188 = Expression(O=deconstruct_29.ZComponent, Expression="FORMAT(\"{0:R}\",O)")
panel_282 = Panel(expression_186)
panel_283 = Panel(expression_187)
panel_284 = Panel(expression_188)
addition_13 = Addition(A=panel_282, B=panel_283)
expression_189 = Expression(O=addition_13, Expression="FORMAT(\"{0:R}\",O)")
panel_285 = Panel(expression_189)
division_26 = Division(A=panel_285, B=2)
expression_190 = Expression(O=division_26, Expression="FORMAT(\"{0:R}\",O)")
panel_286 = Panel(expression_190)
scale_56 = Scale(Geometry=scale_55.Geometry, Center=Point(0, 0, 0), Factor=expr("1/X", panel_286))  # -> Geometry, Transform
scale_57 = Scale(Geometry=curve_138, Center=Point(0, 0, 0), Factor=expr("1/X", panel_286))  # -> Geometry, Transform
evaluate_length_75 = EvaluateLength(Curve=scale_57.Geometry, Length=1, Normalized=True)  # -> Point, Tangent, Parameter
deconstruct_30 = Deconstruct(Point=evaluate_length_75.Point)  # -> XComponent, YComponent, ZComponent
expression_191 = Expression(O=deconstruct_30.YComponent, Expression="FORMAT(\"{0:R}\",O)")
expression_192 = Expression(O=deconstruct_30.XComponent, Expression="FORMAT(\"{0:R}\",O)")
expression_193 = Expression(O=deconstruct_30.ZComponent, Expression="FORMAT(\"{0:R}\",O)")
panel_287 = Panel(expression_191)
panel_288 = Panel(expression_192)
panel_289 = Panel(expression_193)
division_27 = Division(A=panel_283, B=panel_282)
expression_194 = Expression(O=division_27, Expression="FORMAT(\"{0:R}\",O)")
panel_290 = Panel(expression_194)
curve_139 = Curve(scale_57.Geometry)
point_26 = Point(scale_56.Geometry)

move_31 = Move(Geometry=curve_139, Motion=Vector(15, 0, 0))  # -> Geometry, Transform
mirror_30 = Mirror(Geometry=curve_139, Plane=PlaneYZ(0, 0, 0))  # -> Geometry, Transform; disabled
curve_140 = Curve(move_31.Geometry)

vector_xyz_20 = VectorXYZ(XComponent=15, YComponent=1.5, ZComponent=0)  # -> Vector, Length
curve_141 = Curve(curve_139)
end_points_19 = EndPoints(Curve=curve_141)  # -> Start, End
rectangle_2pt_19 = Rectangle2Pt(Plane=PlaneXY(0, 0, 0), PointA=end_points_19.Start, PointB=end_points_19.End, Radius=0)  # -> Rectangle, Length
deconstuct_rectangle_7 = DeconstuctRectangle(Rectangle=rectangle_2pt_19.Rectangle)  # -> BasePlane, XInterval, YInterval
deconstruct_domain_15 = DeconstructDomain(Domain=deconstuct_rectangle_7.YInterval)  # -> Start, End
deconstruct_domain_16 = DeconstructDomain(Domain=deconstuct_rectangle_7.XInterval)  # -> Start, End
scale_nu_7 = ScaleNU(
    Geometry=curve_139,
    Plane=PlaneXY(0, 0, 0),
    ScaleX=expr("1/X", deconstruct_domain_16.End),
    ScaleY=expr("1/X", deconstruct_domain_15.End),
    ScaleZ=1)  # -> Geometry, Transform
curve_142 = Curve(scale_nu_7.Geometry)
move_32 = Move(Geometry=curve_142, Motion=vector_xyz_20.Vector)  # -> Geometry, Transform
curve_143 = Curve(move_32.Geometry)

digit_scroller_101 = DigitScroller(Scroller_Digits=12, Scroller_Prefix=" ", Scroller_Radix=2, Scroller_Value=0)
stream_filter_26 = StreamFilter(Gate=number_slider_24, Stream0=curve_139, Stream1=curve_142)
curve_144 = Curve(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)
curve_145 = Curve(stream_filter_26)
scale_58 = Scale(Geometry=curve_145, Center=Point(0, 0, 0), Factor=expr("2^X", number))  # -> Geometry, Transform
curve_146 = Curve(scale_58.Geometry)
curve_147 = Curve(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)

digit_scroller_102 = DigitScroller(Scroller_Digits=12, Scroller_Prefix="Digit Scroller", Scroller_Radix=1, Scroller_Value=0.00140149998)
number_slider_28 = Slider(256, range=0..65536)
radians_14 = Radians(Degrees=number_3)

expression_195 = Expression(O=radians_14, Expression="FORMAT(\"{0:0.00000000000000000000}\",O)")
panel_296 = Panel(expression_195)
curve_148 = Curve(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)
number_27 = Number(number_5)

digit_scroller_103 = DigitScroller(Scroller_Digits=12, Scroller_Prefix=" ", Scroller_Radix=7, Scroller_Value=16)

number_slider_29 = Slider(1, range=0..1)
end_points_20 = EndPoints(Curve=curve_146)  # -> Start, End
rectangle_2pt_20 = Rectangle2Pt(Plane=PlaneXY(0, 0, 0), PointA=end_points_20.Start, PointB=end_points_20.End, Radius=0)  # -> Rectangle, Length

series_15 = Series(Start=0, Step=panel_296, Count=number_27)
expression_196 = Expression(O=series_15, Expression="FORMAT(\"{0:R}\",O)")  # disabled
panel_297 = Panel(expression_196)
bounds_22 = Bounds(Numbers=series_15)
expression_197 = Expression(X=number_27, Expression="1/X")
duplicate_data_16 = DuplicateData(Data=expression_197, Number=number_27, Order=True)

curve_graph_mapper_13 = CurveGraphMapper(Curves=curve_146, Rectangle=rectangle_2pt_20.Rectangle, Values=series_15, Flip=False, Snap=True, TextSize=0.015625)  # -> Mapped, GraphCurves, GraphPoints, ValueLines, ValuePoints, MappedLines, MappedPoints, Boundary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; disabled
graphmapper_13 = GraphMapper(Curve=curve_146, Boundary=rectangle_2pt_20.Rectangle, Numbers=series_15, Input=bounds_22, Output=bounds_22, bobo=False)
stream_filter_27 = StreamFilter(Gate=number_slider_25, Stream0=curve_graph_mapper_13.Mapped, Stream1=graphmapper_13)

turtle_14 = DotNETVBScriptLEGACY(Forward=duplicate_data_16, Left=stream_filter_27)  # -> Output, Points; inputs Forward: list, Left: list; same code as turtle

expression_198 = Expression(O=turtle_14.Points, Expression="FORMAT(\"{0:R}\",O)")
panel_298 = Panel(expression_198)

point_27 = Point(turtle_14.Points)
scale_59 = Scale(Geometry=point_27, Center=Point(0, 0, 0), Factor=expr("2^X", digit_scroller_103))  # -> Geometry, Transform

interpolate_t_14 = InterpolateT(Vertices=scale_59.Geometry, TangentStart=Vector(0.0625, 0, 0), TangentEnd=Vector(0, 0, 0), KnotStyle=2)  # -> Curve, Length, Domain
evaluate_length_76 = EvaluateLength(Curve=interpolate_t_14.Curve, Length=1, Normalized=True)  # -> Point, Tangent, Parameter
line_sdl_37 = LineSDL(Start=evaluate_length_76.Point, Direction=evaluate_length_76.Tangent, Length=1)
mirror_31 = Mirror(Geometry=interpolate_t_14.Curve, Plane=line_sdl_37)  # -> Geometry, Transform
join_curves_29 = JoinCurves(Curves=[interpolate_t_14.Curve, mirror_31.Geometry], Preserve=False)
evaluate_length_77 = EvaluateLength(Curve=join_curves_29, Length=1, Normalized=True)  # -> Point, Tangent, Parameter
rotate_15 = Rotate(Geometry=join_curves_29, Angle=3.141592654, Plane=evaluate_length_77.Point)  # -> Geometry, Transform
join_curves_30 = JoinCurves(Curves=[join_curves_29, rotate_15.Geometry], Preserve=False)
curve_149 = Curve(join_curves_30)

evaluate_length_78 = EvaluateLength(Curve=join_curves_30, Length=1, Normalized=True)  # -> Point, Tangent, Parameter
deconstruct_31 = Deconstruct(Point=evaluate_length_78.Point)  # -> XComponent, YComponent, ZComponent
expression_199 = Expression(O=deconstruct_31.YComponent, Expression="FORMAT(\"{0:R}\",O)")
expression_200 = Expression(O=deconstruct_31.XComponent, Expression="FORMAT(\"{0:R}\",O)")
expression_201 = Expression(O=deconstruct_31.ZComponent, Expression="FORMAT(\"{0:R}\",O)")
panel_299 = Panel(expression_199)
panel_300 = Panel(expression_200)
panel_301 = Panel(expression_201)
addition_14 = Addition(A=panel_299, B=panel_300)
expression_202 = Expression(O=addition_14, Expression="FORMAT(\"{0:R}\",O)")
panel_302 = Panel(expression_202)
division_28 = Division(A=panel_302, B=2)
expression_203 = Expression(O=division_28, Expression="FORMAT(\"{0:R}\",O)")
panel_303 = Panel(expression_203)
scale_60 = Scale(Geometry=scale_59.Geometry, Center=Point(0, 0, 0), Factor=expr("1/X", panel_303))  # -> Geometry, Transform
scale_61 = Scale(Geometry=curve_149, Center=Point(0, 0, 0), Factor=expr("1/X", panel_303))  # -> Geometry, Transform
evaluate_length_79 = EvaluateLength(Curve=scale_61.Geometry, Length=1, Normalized=True)  # -> Point, Tangent, Parameter
deconstruct_32 = Deconstruct(Point=evaluate_length_79.Point)  # -> XComponent, YComponent, ZComponent
expression_204 = Expression(O=deconstruct_32.YComponent, Expression="FORMAT(\"{0:R}\",O)")
expression_205 = Expression(O=deconstruct_32.XComponent, Expression="FORMAT(\"{0:R}\",O)")
expression_206 = Expression(O=deconstruct_32.ZComponent, Expression="FORMAT(\"{0:R}\",O)")
panel_304 = Panel(expression_204)
panel_305 = Panel(expression_205)
panel_306 = Panel(expression_206)
division_29 = Division(A=panel_300, B=panel_299)
expression_207 = Expression(O=division_29, Expression="FORMAT(\"{0:R}\",O)")
panel_307 = Panel(expression_207)
curve_150 = Curve(scale_61.Geometry)
point_28 = Point(scale_60.Geometry)

move_33 = Move(Geometry=curve_150, Motion=Vector(17.5, 0, 0))  # -> Geometry, Transform
mirror_32 = Mirror(Geometry=curve_150, Plane=PlaneYZ(0, 0, 0))  # -> Geometry, Transform; disabled
curve_151 = Curve(move_33.Geometry)

entwine = Entwine(
    Branch0X=curve_37,
    Branch1X=curve_50,
    Branch2X=curve_63,
    Branch3X=curve_76,
    Branch4X=curve_89,
    Branch5X=curve_129,
    Branch6X=curve_140,
    Branch7X=curve_151,
    FlattenInputs=False)

vector_xyz_21 = VectorXYZ(XComponent=17.5, YComponent=1.5, ZComponent=0)  # -> Vector, Length
curve_152 = Curve(curve_150)
end_points_21 = EndPoints(Curve=curve_152)  # -> Start, End
rectangle_2pt_21 = Rectangle2Pt(Plane=PlaneXY(0, 0, 0), PointA=end_points_21.Start, PointB=end_points_21.End, Radius=0)  # -> Rectangle, Length
deconstuct_rectangle_8 = DeconstuctRectangle(Rectangle=rectangle_2pt_21.Rectangle)  # -> BasePlane, XInterval, YInterval
deconstruct_domain_17 = DeconstructDomain(Domain=deconstuct_rectangle_8.YInterval)  # -> Start, End
deconstruct_domain_18 = DeconstructDomain(Domain=deconstuct_rectangle_8.XInterval)  # -> Start, End
scale_nu_8 = ScaleNU(
    Geometry=curve_150,
    Plane=PlaneXY(0, 0, 0),
    ScaleX=expr("1/X", deconstruct_domain_18.End),
    ScaleY=expr("1/X", deconstruct_domain_17.End),
    ScaleZ=1)  # -> Geometry, Transform
curve_153 = Curve(scale_nu_8.Geometry)
move_34 = Move(Geometry=curve_153, Motion=vector_xyz_21.Vector)  # -> Geometry, Transform
curve_154 = Curve(move_34.Geometry)

entwine_2 = Entwine(
    Branch0X=curve_42,
    Branch1X=curve_53,
    Branch2X=curve_66,
    Branch3X=curve_79,
    Branch4X=curve_92,
    Branch5X=curve_132,
    Branch6X=curve_143,
    Branch7X=curve_154,
    FlattenInputs=False)
entwine_3 = Entwine(Branch0X=entwine_2, Branch1X=entwine, FlattenInputs=False)

digit_scroller_104 = DigitScroller(Scroller_Digits=12, Scroller_Prefix=" ", Scroller_Radix=2, Scroller_Value=30.9312132)
stream_filter_28 = StreamFilter(Gate=number_slider_24, Stream0=curve_150, Stream1=curve_153)
curve_155 = Curve(stream_filter_28)
scale_62 = Scale(Geometry=curve_155, Center=Point(0, 0, 0), Factor=expr("2^X", number))  # -> Geometry, Transform
curve_156 = Curve(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)
curve_157 = Curve(scale_62.Geometry)
curve_158 = Curve(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)

digit_scroller_105 = DigitScroller(Scroller_Digits=12, Scroller_Prefix="Digit Scroller", Scroller_Radix=1, Scroller_Value=0.00140149998)
radians_15 = Radians(Degrees="0.001373312102167")
number_slider_30 = Slider(256, range=0..65536)

expression_208 = Expression(O=radians_15, Expression="FORMAT(\"{0:0.00000000000000000000}\",O)")
panel_312 = Panel(expression_208)
curve_159 = Curve(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)
number_28 = Number(number_5)

digit_scroller_106 = DigitScroller(Scroller_Digits=12, Scroller_Prefix=" ", Scroller_Radix=7, Scroller_Value=16)

deconstruct_vector = DeconstructVector(Vector=vector_xyz_21.Vector)  # -> XComponent, YComponent, ZComponent
vector_xyz_22 = VectorXYZ(
    XComponent=deconstruct_vector.XComponent,
    YComponent=expr("X+2.5", deconstruct_vector.YComponent),
    ZComponent=deconstruct_vector.ZComponent)  # -> Vector, Length

number_slider_31 = Slider(1, range=0..1)
end_points_22 = EndPoints(Curve=curve_157)  # -> Start, End
rectangle_2pt_22 = Rectangle2Pt(Plane=PlaneXY(0, 0, 0), PointA=end_points_22.Start, PointB=end_points_22.End, Radius=0)  # -> Rectangle, Length

series_16 = Series(Start=0, Step=panel_312, Count=number_28)
expression_209 = Expression(O=series_16, Expression="FORMAT(\"{0:R}\",O)")  # disabled
panel_313 = Panel(expression_209)
bounds_23 = Bounds(Numbers=series_16)
expression_210 = Expression(X=number_28, Expression="1/X")
duplicate_data_17 = DuplicateData(Data=expression_210, Number=number_28, Order=True)

curve_graph_mapper_14 = CurveGraphMapper(Curves=curve_157, Rectangle=rectangle_2pt_22.Rectangle, Values=series_16, Flip=False, Snap=True, TextSize=0.015625)  # -> Mapped, GraphCurves, GraphPoints, ValueLines, ValuePoints, MappedLines, MappedPoints, Boundary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; disabled
graphmapper_14 = GraphMapper(Curve=curve_157, Boundary=rectangle_2pt_22.Rectangle, Numbers=series_16, Input=bounds_23, Output=bounds_23, bobo=False)
stream_filter_29 = StreamFilter(Gate=number_slider_25, Stream0=curve_graph_mapper_14.Mapped, Stream1=graphmapper_14)

turtle_15 = DotNETVBScriptLEGACY(Forward=duplicate_data_17, Left=stream_filter_29)  # -> Output, Points; inputs Forward: list, Left: list; same code as turtle

expression_211 = Expression(O=turtle_15.Points, Expression="FORMAT(\"{0:R}\",O)")
panel_314 = Panel(expression_211)

point_29 = Point(turtle_15.Points)
scale_63 = Scale(Geometry=point_29, Center=Point(0, 0, 0), Factor=expr("2^X", digit_scroller_106))  # -> Geometry, Transform

interpolate_t_15 = InterpolateT(Vertices=scale_63.Geometry, TangentStart=Vector(0.0625, 0, 0), TangentEnd=Vector(0, 0, 0), KnotStyle=2)  # -> Curve, Length, Domain
evaluate_length_80 = EvaluateLength(Curve=interpolate_t_15.Curve, Length=1, Normalized=True)  # -> Point, Tangent, Parameter
line_sdl_38 = LineSDL(Start=evaluate_length_80.Point, Direction=evaluate_length_80.Tangent, Length=1)
mirror_33 = Mirror(Geometry=interpolate_t_15.Curve, Plane=line_sdl_38)  # -> Geometry, Transform
join_curves_31 = JoinCurves(Curves=[interpolate_t_15.Curve, mirror_33.Geometry], Preserve=False)
evaluate_length_81 = EvaluateLength(Curve=join_curves_31, Length=1, Normalized=True)  # -> Point, Tangent, Parameter
rotate_16 = Rotate(Geometry=join_curves_31, Angle=3.141592654, Plane=evaluate_length_81.Point)  # -> Geometry, Transform
join_curves_32 = JoinCurves(Curves=[join_curves_31, rotate_16.Geometry], Preserve=False)
curve_160 = Curve(join_curves_32)

evaluate_length_82 = EvaluateLength(Curve=join_curves_32, Length=1, Normalized=True)  # -> Point, Tangent, Parameter
deconstruct_33 = Deconstruct(Point=evaluate_length_82.Point)  # -> XComponent, YComponent, ZComponent
expression_212 = Expression(O=deconstruct_33.YComponent, Expression="FORMAT(\"{0:R}\",O)")
expression_213 = Expression(O=deconstruct_33.XComponent, Expression="FORMAT(\"{0:R}\",O)")
expression_214 = Expression(O=deconstruct_33.ZComponent, Expression="FORMAT(\"{0:R}\",O)")
panel_315 = Panel(expression_212)
panel_316 = Panel(expression_213)
panel_317 = Panel(expression_214)
addition_15 = Addition(A=panel_315, B=panel_316)
expression_215 = Expression(O=addition_15, Expression="FORMAT(\"{0:R}\",O)")
panel_318 = Panel(expression_215)
division_30 = Division(A=panel_318, B=2)
expression_216 = Expression(O=division_30, Expression="FORMAT(\"{0:R}\",O)")
panel_319 = Panel(expression_216)
scale_64 = Scale(Geometry=scale_63.Geometry, Center=Point(0, 0, 0), Factor=expr("1/X", panel_319))  # -> Geometry, Transform
scale_65 = Scale(Geometry=curve_160, Center=Point(0, 0, 0), Factor=expr("1/X", panel_319))  # -> Geometry, Transform
evaluate_length_83 = EvaluateLength(Curve=scale_65.Geometry, Length=1, Normalized=True)  # -> Point, Tangent, Parameter
deconstruct_34 = Deconstruct(Point=evaluate_length_83.Point)  # -> XComponent, YComponent, ZComponent
expression_217 = Expression(O=deconstruct_34.YComponent, Expression="FORMAT(\"{0:R}\",O)")
expression_218 = Expression(O=deconstruct_34.XComponent, Expression="FORMAT(\"{0:R}\",O)")
expression_219 = Expression(O=deconstruct_34.ZComponent, Expression="FORMAT(\"{0:R}\",O)")
panel_320 = Panel(expression_217)
panel_321 = Panel(expression_218)
panel_322 = Panel(expression_219)
division_31 = Division(A=panel_316, B=panel_315)
expression_220 = Expression(O=division_31, Expression="FORMAT(\"{0:R}\",O)")
panel_323 = Panel(expression_220)
curve_161 = Curve(scale_65.Geometry)
point_30 = Point(scale_64.Geometry)

move_35 = Move(Geometry=curve_161, Motion=vector_xyz_22.Vector)  # -> Geometry, Transform
mirror_34 = Mirror(Geometry=curve_161, Plane=PlaneYZ(0, 0, 0))  # -> Geometry, Transform; disabled
curve_162 = Curve(move_35.Geometry)

entwine_4 = Entwine(
    Branch0X=curve_162,
    Branch1X=curve_47,
    Branch2X=curve_60,
    Branch3X=curve_73,
    Branch4X=curve_86,
    Branch5X=curve_114,
    FlattenInputs=False)
entwine_5 = Entwine(Branch0X=entwine_4, Branch1X=entwine_3, FlattenInputs=False)

curve_163 = Curve(entwine_4)
curve_164 = Curve(entwine_5)
