# Grasshopper definition XHG.⠀⠀⠀⠀ⵙᗝⵙꖴⵙⓄⵙᙏⵙᕤᕦⵙꖴⵙᔓᔕⵙ◯ⵙИNⵙⓄⵙꖴⵙ✤ⵙꖴⵙᔓᔕⵙИNⵙᗩⵙᴥⵙ✤ⵙ◯ⵙᙁⵙᗩⵙᗱᗴⵙᗝⵙꖴⵙ◯ⵙᗱᗴⵙᕤᕦⵙᗝⵙᗱᗴⵙ◯ⵙᙁⵙᑎⵙꗳⵙ⠀⠀⠀⠀◯⠀⠀⠀⠀ⵙ⠀⠀⠀⠀◯⠀⠀⠀⠀ⵙꗳⵙᑎⵙᙁⵙ◯ⵙᗱᗴⵙᗝⵙᕤᕦⵙᗱᗴⵙ◯ⵙꖴⵙᗝⵙᗱᗴⵙᗩⵙᙁⵙ◯ⵙ✤ⵙᴥⵙᗩⵙИNⵙᔓᔕⵙꖴⵙ✤ⵙꖴⵙⓄⵙИNⵙ◯ⵙᔓᔕⵙꖴⵙᕤᕦⵙᙏⵙⓄⵙꖴⵙᗝⵙ⠀⠀⠀⠀.GHX (Grasshopper 1.0.7)
# plug-ins: Pufferfish, Shader Nodes

digit_scroller = DigitScroller(Scroller_Digits=12, Scroller_Prefix="Digit Scroller", Scroller_Radix=11, Scroller_Value=96)
number_slider = Slider(31, range=0..100)
number_slider_2 = Slider(32, range=0..100)
digit_scroller_2 = DigitScroller(Scroller_Digits=12, Scroller_Prefix="Digit Scroller", Scroller_Radix=11, Scroller_Value=64)
xz_plane = XZPlane(Origin=Point(0, 0, 0))
digit_scroller_3 = DigitScroller(Scroller_Digits=12, Scroller_Prefix="Digit Scroller", Scroller_Radix=1, Scroller_Value=0.4205597227)
digit_scroller_4 = DigitScroller(Scroller_Digits=12, Scroller_Prefix="Digit Scroller", Scroller_Radix=1, Scroller_Value=4.411602319)
digit_scroller_5 = DigitScroller(Scroller_Digits=12, Scroller_Prefix="Digit Scroller", Scroller_Radix=1, Scroller_Value=4.411602319)
number = Number(Slider(256, range=0..1024))
digit_scroller_6 = DigitScroller(Scroller_Digits=12, Scroller_Prefix="Digit Scroller", Scroller_Radix=11, Scroller_Value=88)
xz_plane_2 = XZPlane(Origin=Point(0, 0, 0))
digit_scroller_7 = DigitScroller(Scroller_Digits=12, Scroller_Prefix="Digit Scroller", Scroller_Radix=1, Scroller_Value=4.411602319)
digit_scroller_8 = DigitScroller(Scroller_Digits=12, Scroller_Prefix="Digit Scroller", Scroller_Radix=1, Scroller_Value=4.411602319)
create_material = CreateMaterial(Diffuse=RGB(191, 191, 191), Specular=RGB(255, 255, 255), Emission=RGB(0, 0, 0), Transparency=0, Shine=0)
geometry = Geometry()  # -> Position, Normal, Tangent, TrueNormal, Incoming, Parametric, Backfacing, Pointiness
layer_weight = LayerWeight(Blend=0.5, Normal=geometry.Normal)  # -> Fresnel, Facing
subtract = Subtract(Value1=1, Value2=layer_weight.Facing, UseClamp=False)
power = Power(Value1=subtract, Value2=2, UseClamp=False)
subtract_2 = Subtract(Value1=1, Value2=power, UseClamp=False)
power_2 = Power(Value1=subtract_2, Value2=0.5, UseClamp=False)
subtract_3 = Subtract(Value1=1, Value2=power_2, UseClamp=False)
point = Point(Point(1, 1, 0))
quad_sphere = QuadSphere(Base=point, Radius=1)
panel = Panel(subtract)
mesh_brep = MeshBrep(
    Brep=quad_sphere,
    Settings={GridMaxCount=0, GridMinCount=16, JaggedSeams=False, MaxEdgeLength=0, MinEdgeLength=0.0001, MinTolerance=0, Refine=True, RefineAngle=0, RelativeTolerance=0.65, SimplePlanes=True, Tolerance=0})
infoglasses = InfoGlasses(Run=True, Language=0, assemSet=False, cateSet=False, showName=False)
plane_surface = PlaneSurface(Plane=PlaneXY(0, 0, 0), XSize=Domain(0, 1), YSize=Domain(0, 1))
color_ramp = ColorRamp(Fac=subtract, StopColours=[RGBA(0, 0, 0, 0), RGB(255, 255, 255)], StopPositions=[0, 1], Interpolation="Ease")  # -> Color, Alpha
emission_bsdf = EmissionBSDF(Color=color_ramp.Color, Strength=1)
custom_preview = CustomPreview(
    Geometry=mesh_brep,
    Material={diffuse=RGB(255, 105, 180), emission=RGB(0, 0, 0), shine=0, specular=RGB(255, 255, 255), transparency=0})
output = Output(Surface=subtract, Volume=RGB(128, 128, 128), Displacement=Vector(0, 0, 0))
digit_scroller_9 = DigitScroller(Scroller_Digits=12, Scroller_Prefix="Digit Scroller", Scroller_Radix=1, Scroller_Value=4.411602319)
line_sdl = LineSDL(Start=Point(0, 0, 0), Direction=Vector(1, 0, 0), Length=1)
digit_scroller_10 = DigitScroller(Scroller_Digits=12, Scroller_Prefix="Digit Scroller", Scroller_Radix=5, Scroller_Value=99999)
digit_scroller_11 = DigitScroller(Scroller_Digits=12, Scroller_Prefix="Digit Scroller", Scroller_Radix=3, Scroller_Value=180)
digit_scroller_12 = DigitScroller(Scroller_Digits=12, Scroller_Prefix="Digit Scroller", Scroller_Radix=11, Scroller_Value=1e+11)
digit_scroller_13 = DigitScroller(Scroller_Digits=12, Scroller_Prefix="Digit Scroller", Scroller_Radix=3, Scroller_Value=0.25)
line_sdl_2 = LineSDL(Start=Point(0, 0, 0), Direction=Vector(1, 0, 0), Length=1)
digit_scroller_14 = DigitScroller(Scroller_Digits=12, Scroller_Prefix="Digit Scroller", Scroller_Radix=5, Scroller_Value=99999)
digit_scroller_15 = DigitScroller(Scroller_Digits=12, Scroller_Prefix="Digit Scroller", Scroller_Radix=11, Scroller_Value=1e+11)
digit_scroller_16 = DigitScroller(Scroller_Digits=12, Scroller_Prefix="Digit Scroller", Scroller_Radix=3, Scroller_Value=180)
digit_scroller_17 = DigitScroller(Scroller_Digits=12, Scroller_Prefix="Digit Scroller", Scroller_Radix=3, Scroller_Value=0.25)
line_sdl_3 = LineSDL(Start=Point(0, 0, 0), Direction=Vector(1, 0, 0), Length=1)
digit_scroller_18 = DigitScroller(Scroller_Digits=12, Scroller_Prefix="Digit Scroller", Scroller_Radix=7, Scroller_Value=4)

curve = Curve(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)
curve_2 = Curve(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)

colour_picker = ColourPicker(PickedColour=RGB(176, 176, 176))
create_material_2 = CreateMaterial(Diffuse=colour_picker, Specular=RGB(255, 255, 255), Emission=RGB(0, 0, 0), Transparency=0, Shine=0)
custom_preview_2 = CustomPreview(Geometry=curve, Material=create_material_2)

digit_scroller_19 = DigitScroller(Scroller_Digits=12, Scroller_Prefix="Digit Scroller", Scroller_Radix=11, Scroller_Value=94)
number_slider_3 = Slider(31, range=0..100)
number_slider_4 = Slider(32, range=0..100)
digit_scroller_20 = DigitScroller(Scroller_Digits=12, Scroller_Prefix="Digit Scroller", Scroller_Radix=11, Scroller_Value=64)

digit_scroller_21 = DigitScroller(Scroller_Digits=12, Scroller_Prefix="Digit Scroller", Scroller_Radix=1, Scroller_Value=0.00204767472)
number_slider_5 = Slider(1, range=0..1)
panel_2 = Panel("""16                0.526707628425
32                0.131193530865
64                0.03277086292
128              0.00819109195275
256              0.00204767472315""")
number_slider_6 = Slider(256, range=0..256)
one_over_x = OneOverX(Value=number_slider_6)
radians = Radians(Degrees="0.00204767472315")
duplicate_data = DuplicateData(Data=one_over_x, Number=number_slider_6, Order=True)
series = Series(Start=0, Step=radians, Count=number_slider_6)
division = Division(A=0.5267076284, B=0.1311935309)
turtle = DotNETVBScriptLEGACY(Forward=duplicate_data, Left=series)  # -> Output, Points; inputs Forward: list, Left: list
# ---------- turtle: VB ----------
    Dim i As Integer
    Dim dir As New On3dVector(1, 0, 0)    
    Dim pos As New On3dVector(0, 0, 0) 
    Dim axis As New On3dVector(0, 0, 1)
    Dim pnts As New List(Of On3dVector)

    pnts.Add(pos)
    
    For i = 0 To Forward.Count() - 1
      Dim P As New On3dVector
      dir.Rotate(Left(i), axis)      
      P = dir * Forward(i) + pnts(i)
      pnts.Add(P)
    Next
    
    Points = pnts
# ---------- end turtle ----------
panel_3 = Panel("""16    0.52916013400
32    0.13119985428""")
panel_4 = Panel("""16    0.35233813056
32    0.08793657256""")
point_2 = Point(turtle.Points)
interpolate = Interpolate(Vertices=turtle.Points, Degree=3, Periodic=False, KnotStyle=0)  # -> Curve, Length, Domain

division_2 = Division(A=0.008191091953, B=0.002047674723)
evaluate_length = EvaluateLength(Curve=interpolate.Curve, Length=1, Normalized=True)  # -> Point, Tangent, Parameter
line_sdl_4 = LineSDL(Start=evaluate_length.Point, Direction=evaluate_length.Tangent, Length=1)
mirror = Mirror(Geometry=interpolate.Curve, Plane=line_sdl_4)  # -> Geometry, Transform
join_curves = JoinCurves(Curves=[interpolate.Curve, mirror.Geometry], Preserve=False)
end_points = EndPoints(Curve=join_curves)  # -> Start, End
line = Line(StartPoint=end_points.Start, EndPoint=end_points.End)
evaluate_length_2 = EvaluateLength(Curve=join_curves, Length=1, Normalized=True)  # -> Point, Tangent, Parameter
curve_middle = CurveMiddle(Curve=join_curves)
angle = Angle(VectorA=Vector(21.5, 0, 0), VectorB=evaluate_length_2.Tangent)  # -> Angle, Reflex
evaluate_length_3 = EvaluateLength(Curve=mirror.Geometry, Length=0, Normalized=True)  # -> Point, Tangent, Parameter
angle_2 = Angle(VectorA=Vector(1.4375, 0, 0), VectorB=line)  # -> Angle, Reflex
rotate = Rotate(Geometry=join_curves, Angle=expr("-X", angle_2.Angle), Plane=curve_middle)  # -> Geometry, Transform
vector_2pt = Vector2Pt(PointA=curve_middle, PointB=Point(0, 0, 0), Unitize=False)  # -> Vector, Length
rotate_2 = Rotate(Geometry=mirror.Geometry, Angle=3.141592654, Plane=evaluate_length_3.Point)  # -> Geometry, Transform
move = Move(Geometry=rotate.Geometry, Motion=vector_2pt.Vector)  # -> Geometry, Transform
curve_domain = CurveDomain(Curve=move.Geometry)  # -> Curve, Domain
deconstruct_domain = DeconstructDomain(Domain=curve_domain.Domain)  # -> Start, End
construct_domain = ConstructDomain(DomainStart=deconstruct_domain.End, DomainEnd=expr("X/2", deconstruct_domain.End))
sub_curve = SubCurve(BaseCurve=curve_domain.Curve, Domain=construct_domain)
evaluate_length_4 = EvaluateLength(Curve=sub_curve, Length=1, Normalized=True)  # -> Point, Tangent, Parameter
rotate_3 = Rotate(Geometry=sub_curve, Angle=3.141592654, Plane=evaluate_length_4.Point)  # -> Geometry, Transform
join_curves_2 = JoinCurves(Curves=[sub_curve, rotate_3.Geometry], Preserve=False)
rotate_4 = Rotate(Geometry=join_curves, Angle=expr("-X", angle_2.Angle), Plane=curve_middle)  # -> Geometry, Transform
bounding_box = BoundingBox(Content=join_curves_2, Plane=PlaneXY(0, 0, 0), UnionBox=True)  # -> Box, Box_2
deconstruct_box = DeconstructBox(Box=bounding_box.Box)  # -> Plane, X, Y, Z
deconstruct_domain_2 = DeconstructDomain(Domain=deconstruct_box.X)  # -> Start, End
deconstruct_domain_3 = DeconstructDomain(Domain=deconstruct_box.Y)  # -> Start, End
scale = Scale(Geometry=join_curves_2, Center=Point(0, 0, 0), Factor=expr("1/X", deconstruct_domain_2.End))  # -> Geometry, Transform
division_3 = Division(A=deconstruct_domain_2.End, B=deconstruct_domain_3.End)
curve_3 = Curve(scale.Geometry)
bounding_box_2 = BoundingBox(Content=curve_3, Plane=PlaneXY(0, 0, 0), UnionBox=True)  # -> Box, Box_2
deconstruct_box_2 = DeconstructBox(Box=bounding_box_2.Box)  # -> Plane, X, Y, Z
rectangle = Rectangle(Plane=PlaneXY(0, 0, 0), XSize=deconstruct_box_2.X, YSize=deconstruct_box_2.Y, Radius=0)  # -> Rectangle, Length

number_2 = Number(number_slider_6)
curve_4 = Curve(curve_3)
divide_curve = DivideCurve(Curve=curve_4, Count=number_2, Kinks=False)  # -> Points, Tangents, Parameters
curvature = Curvature(Curve=curve_4, Parameter=divide_curve.Parameters)  # -> Point, Curvature, Curvature_2
deconstruct_arc = DeconstructArc(Arc=curvature.Curvature_2)  # -> BasePlane, Radius, Angle
one_over_x_2 = OneOverX(Value=deconstruct_arc.Radius)
quick_graph = QuickGraph(one_over_x_2, SortOrder=0)

curvature_graph = CurvatureGraph(Curve=curve_4, Density=1, Scale=digit_scroller_19)
series_2 = Series(Start=0, Step=one_over_x, Count=number_2)
construct_point = ConstructPoint(XCoordinate=series_2, YCoordinate=one_over_x_2, ZCoordinate=0)
polyline = PolyLine(Vertices=construct_point, Closed=False)
quick_graph_2 = QuickGraph(one_over_x_2, SortOrder=0)
explode = Explode(Curve=polyline, Recursive=True)  # -> Segments, Vertices
list_length = ListLength(List=explode.Segments)  # -> expr("X/4", Length)
list_item = ListItem(List=explode.Segments, Index=expr("X+(X/2)", list_length), Wrap=False)
list_item_2 = ListItem(List=explode.Segments, Index=expr("X-(X/2)", list_length), Wrap=False)
angle_3 = Angle(VectorA=list_item, VectorB=list_item_2)  # -> Angle, Reflex
expression = Expression(Variable_x=angle_3.Angle, Expression="Format(\"{0:R}\", x)")
degrees = Degrees(Radians=angle_3.Angle)
panel_5 = Panel(degrees)

panel_6 = Panel(division_3)
degrees_2 = Degrees(Radians=angle.Angle)
panel_7 = Panel(degrees_2)

number_3 = Number(number_slider_6)
curve_5 = Curve(join_curves)
divide_curve_2 = DivideCurve(Curve=curve_5, Count=number_3, Kinks=False)  # -> Points, Tangents, Parameters
curvature_2 = Curvature(Curve=curve_5, Parameter=divide_curve_2.Parameters)  # -> Point, Curvature, Curvature_2
deconstruct_arc_2 = DeconstructArc(Arc=curvature_2.Curvature_2)  # -> BasePlane, Radius, Angle
one_over_x_3 = OneOverX(Value=deconstruct_arc_2.Radius)
quick_graph_3 = QuickGraph(one_over_x_3, SortOrder=0)

curvature_graph_2 = CurvatureGraph(Curve=curve_5, Density=1, Scale=digit_scroller)
series_3 = Series(Start=0, Step=one_over_x, Count=number_3)
construct_point_2 = ConstructPoint(XCoordinate=series_3, YCoordinate=one_over_x_3, ZCoordinate=0)
polyline_2 = PolyLine(Vertices=construct_point_2, Closed=False)
quick_graph_4 = QuickGraph(one_over_x_3, SortOrder=0)
explode_2 = Explode(Curve=polyline_2, Recursive=True)  # -> Segments, Vertices
list_length_2 = ListLength(List=explode_2.Segments)  # -> expr("X/2", Length)
list_item_3 = ListItem(List=explode_2.Segments, Index=expr("X-1", list_length_2), Wrap=False)
list_item_4 = ListItem(List=explode_2.Segments, Index=list_length_2, Wrap=False)
angle_4 = Angle(VectorA=list_item_4, VectorB=list_item_3)  # -> Angle, Reflex
expression_2 = Expression(Variable_x=angle_4.Angle, Expression="Format(\"{0:R}\", x)")
degrees_3 = Degrees(Radians=angle_4.Angle)
panel_8 = Panel(degrees_3)

number_4 = Number(number_slider_6)
curve_6 = Curve(curve_3)
divide_curve_3 = DivideCurve(Curve=curve_6, Count=number_4, Kinks=False)  # -> Points, Tangents, Parameters
curvature_3 = Curvature(Curve=curve_6, Parameter=divide_curve_3.Parameters)  # -> Point, Curvature, Curvature_2
deconstruct_arc_3 = DeconstructArc(Arc=curvature_3.Curvature_2)  # -> BasePlane, Radius, Angle
one_over_x_4 = OneOverX(Value=deconstruct_arc_3.Radius)
quick_graph_5 = QuickGraph(one_over_x_4, SortOrder=0)

relative_differences = RelativeDifferences(Values=one_over_x_4)
panel_9 = Panel(relative_differences)
quick_graph_6 = QuickGraph(panel_9, SortOrder=0)

relative_differences_2 = RelativeDifferences(Values=relative_differences)
panel_10 = Panel(relative_differences_2)
quick_graph_7 = QuickGraph(panel_10, SortOrder=0)

relative_differences_3 = RelativeDifferences(Values=relative_differences_2)
panel_11 = Panel(relative_differences_3)
quick_graph_8 = QuickGraph(panel_11, SortOrder=0)

digit_scroller_22 = DigitScroller(Scroller_Digits=12, Scroller_Prefix="Digit Scroller", Scroller_Radix=11, Scroller_Value=93)
curvature_graph_3 = CurvatureGraph(Curve=curve_6, Density=1, Scale=digit_scroller_22)
series_4 = Series(Start=0, Step=expr("1/X", number_4), Count=number_4)
construct_point_3 = ConstructPoint(XCoordinate=series_4, YCoordinate=expr("X/2", one_over_x_4), ZCoordinate=0)
polyline_3 = PolyLine(Vertices=construct_point_3, Closed=False)
quick_graph_9 = QuickGraph(one_over_x_4, SortOrder=0)
number_slider_7 = Slider(31, range=0..100)
number_slider_8 = Slider(32, range=0..100)
explode_3 = Explode(Curve=polyline_3, Recursive=True)  # -> Segments, Vertices
list_length_3 = ListLength(List=explode_3.Segments)  # -> expr("X/4", Length)
digit_scroller_23 = DigitScroller(Scroller_Digits=12, Scroller_Prefix="Digit Scroller", Scroller_Radix=11, Scroller_Value=64)
list_item_5 = ListItem(List=explode_3.Segments, Index=expr("X+(X/2)", list_length_3), Wrap=False)
list_item_6 = ListItem(List=explode_3.Segments, Index=expr("X-(X/2)", list_length_3), Wrap=False)
angle_5 = Angle(VectorA=list_item_5, VectorB=list_item_6)  # -> Angle, Reflex
expression_3 = Expression(X=angle_5.Angle, Expression="Format(\"{0:R}\", x)")
degrees_4 = Degrees(Radians=angle_5.Angle)
panel_12 = Panel(degrees_4)

digit_scroller_24 = DigitScroller(Scroller_Digits=12, Scroller_Prefix="Digit Scroller", Scroller_Radix=11, Scroller_Value=93)
interpolate_2 = Interpolate(Vertices=construct_point_3, Degree=3, Periodic=False, KnotStyle=1)  # -> Curve, Length, Domain
curvature_graph_4 = CurvatureGraph(Curve=interpolate_2.Curve, Density=1, Scale=digit_scroller_24)
bounding_box_3 = BoundingBox(Content=interpolate_2.Curve, Plane=PlaneXY(0, 0, 0))  # -> Box, Box_2
deconstruct_box_3 = DeconstructBox(Box=bounding_box_3.Box)  # -> Plane, X, Y, Z
deconstruct_domain_4 = DeconstructDomain(Domain=deconstruct_box_3.X)  # -> Start, End
deconstruct_domain_5 = DeconstructDomain(Domain=deconstruct_box_3.Y)  # -> Start, End
scale_nu = ScaleNU(
    Geometry=interpolate_2.Curve,
    Plane=PlaneXY(0, 0, 0),
    ScaleX=expr("1/X", deconstruct_domain_4.End),
    ScaleY=expr(".5/X", deconstruct_domain_5.End),
    ScaleZ=1)  # -> Geometry, Transform
move_2 = Move(Geometry=scale_nu.Geometry, Motion=Vector(0, -1, 0))  # -> Geometry, Transform

curve_7 = Curve(curve_6)
curve_8 = Curve(move_2.Geometry)

number_slider_9 = Slider(40, range=0..256)
number_5 = Number(number)

digit_scroller_25 = DigitScroller(Scroller_Digits=12, Scroller_Prefix="Digit Scroller", Scroller_Radix=1, Scroller_Value=0.9905597227)
number_slider_10 = Slider(29, range=0..256)
number_6 = Number(number)

create_material_3 = CreateMaterial(Diffuse=RGB(235, 235, 235), Specular=RGB(0, 255, 255), Emission=RGB(0, 0, 0), Transparency=0.5, Shine=100)
number_slider_11 = Slider(42, range=0..256)
number_7 = Number(number)
create_material_4 = CreateMaterial(Diffuse=RGB(224, 224, 224), Specular=RGB(0, 255, 255), Emission=RGB(0, 0, 0), Transparency=0.5, Shine=100)
create_material_5 = CreateMaterial(Diffuse=RGB(242, 242, 242), Specular=RGB(0, 255, 255), Emission=RGB(0, 0, 0), Transparency=0.5, Shine=100)

number_slider_12 = Slider(40, range=0..256)
number_8 = Number(number)
create_material_6 = CreateMaterial(Diffuse=RGB(232, 232, 232), Specular=RGB(0, 255, 255), Emission=RGB(0, 0, 0), Transparency=0.5, Shine=100)
create_material_7 = CreateMaterial(Diffuse=RGB(222, 222, 222), Specular=RGB(0, 255, 255), Emission=RGB(0, 0, 0), Transparency=0.5, Shine=100)
create_material_8 = CreateMaterial(Diffuse=RGB(199, 199, 199), Specular=RGB(0, 255, 255), Emission=RGB(0, 0, 0), Transparency=0.5, Shine=100)

digit_scroller_26 = DigitScroller(Scroller_Digits=12, Scroller_Prefix="Digit Scroller", Scroller_Radix=11, Scroller_Value=93)
number_slider_13 = Slider(32, range=0..100)
number_slider_14 = Slider(31, range=0..100)
digit_scroller_27 = DigitScroller(Scroller_Digits=12, Scroller_Prefix="Digit Scroller", Scroller_Radix=11, Scroller_Value=64)

create_material_9 = CreateMaterial(Diffuse=RGB(235, 235, 235), Specular=RGB(0, 255, 255), Emission=RGB(0, 0, 0), Transparency=0.5, Shine=100)
number_slider_15 = Slider(42, range=0..256)
number_9 = Number(number)
create_material_10 = CreateMaterial(Diffuse=RGB(224, 224, 224), Specular=RGB(0, 255, 255), Emission=RGB(0, 0, 0), Transparency=0.5, Shine=100)
create_material_11 = CreateMaterial(Diffuse=RGB(242, 242, 242), Specular=RGB(0, 255, 255), Emission=RGB(0, 0, 0), Transparency=0.5, Shine=100)

number_10 = Number(number_slider_6)

series_5 = Series(Start=0, Step=expr("1/X", number_10), Count=number_10)

number_slider_16 = Slider(42, range=0..256)
number_11 = Number(number)

panel_13 = Panel("""16                0.49642790190
32                0.122908661045
64                0.030606376078
128              0.0076380878337
256              0.001908488092445""")
division_4 = Division(A=0.4964279019, B=0.122908661)
panel_14 = Panel("0.496323571135")
panel_15 = Panel("0.52916013400")
evaluate_length_5 = EvaluateLength(Curve=curve_3, Length=1, Normalized=True)  # -> Point, Tangent, Parameter
yz_plane = YZPlane(Origin=evaluate_length_5.Point)

deconstruct = Deconstruct(Point=evaluate_length_5.Point)  # -> XComponent, YComponent, ZComponent
construct_point_4 = ConstructPoint(XCoordinate=0, YCoordinate=deconstruct.YComponent, ZCoordinate=0)
vector_2pt_2 = Vector2Pt(PointA=construct_point_4, PointB=evaluate_length_5.Point, Unitize=False)  # -> Vector, Length

mirror_2 = Mirror(Geometry=curve_3, Plane=yz_plane)  # -> Geometry, Transform
join_curves_3 = JoinCurves(Curves=[curve_3, mirror_2.Geometry], Preserve=False)
scale_nu_2 = ScaleNU(Geometry=[curve_3, mirror_2.Geometry], Plane=PlaneXY(0, 0, 0), ScaleX=0.5, ScaleY=expr("-X", 0.5), ScaleZ=1)  # -> Geometry, Transform
move_3 = Move(Geometry=scale_nu_2.Geometry, Motion=Vector(1, -0.5, 0))  # -> Geometry, Transform

curve_9 = Curve(move_3.Geometry)

curve_10 = Curve(curve_9)
divide_curve_4 = DivideCurve(Curve=curve_10, Count=number_5, Kinks=False)  # -> Points, Tangents, Parameters
curvature_4 = Curvature(Curve=curve_10, Parameter=divide_curve_4.Parameters)  # -> Point, Curvature, Curvature_2
deconstruct_arc_4 = DeconstructArc(Arc=curvature_4.Curvature_2)  # -> BasePlane, Radius, Angle
one_over_x_5 = OneOverX(Value=deconstruct_arc_4.Radius)
panel_17 = Panel(one_over_x_5)
quick_graph_10 = QuickGraph(one_over_x_5, SortOrder=0)
line_2 = Line(StartPoint=curvature_4.Point, EndPoint=deconstruct_arc_4.BasePlane)
multiplication = Multiplication(A=one_over_x_5, B=Slider(0.015666, range=0..0.5))
line_sdl_5 = LineSDL(Start=curvature_4.Point, Direction=line_2, Length=expr("-ABS(X)", multiplication))
evaluate_length_6 = EvaluateLength(Curve=line_sdl_5, Length=1, Normalized=True)  # -> Point, Tangent, Parameter
interpolate_3 = Interpolate(Vertices=evaluate_length_6.Point, Degree=3, Periodic=False, KnotStyle=2)  # -> Curve, Length, Domain

nurbs_curve = NurbsCurve(Vertices=evaluate_length_6.Point, Degree=11, Periodic=False)  # -> Curve, Length, Domain
bounding_box_4 = BoundingBox(Content=interpolate_3.Curve, Plane=PlaneXY(0, 0, 0), UnionBox=True)  # -> Box, Box_2
deconstruct_box_4 = DeconstructBox(Box=bounding_box_4.Box)  # -> Plane, X, Y, Z
deconstruct_domain_6 = DeconstructDomain(Domain=deconstruct_box_4.Y)  # -> Start, End
relative_differences_4 = RelativeDifferences(Values=[deconstruct_domain_6.Start, deconstruct_domain_6.End])
list_item_7 = ListItem(List=relative_differences_4, Index=1, Wrap=False)
panel_18 = Panel(list_item_7)
curvature_graph_5 = CurvatureGraph(Curve=move_3.Geometry, Density=1, Scale=digit_scroller_6)

curve_11 = Curve(curve_9)
divide_curve_5 = DivideCurve(Curve=curve_11, Count=number_6, Kinks=False)  # -> Points, Tangents, Parameters
curvature_5 = Curvature(Curve=curve_11, Parameter=divide_curve_5.Parameters)  # -> Point, Curvature, Curvature_2
deconstruct_arc_5 = DeconstructArc(Arc=curvature_5.Curvature_2)  # -> BasePlane, Radius, Angle
line_3 = Line(StartPoint=curvature_5.Point, EndPoint=deconstruct_arc_5.BasePlane)
one_over_x_6 = OneOverX(Value=deconstruct_arc_5.Radius)
relative_differences_5 = RelativeDifferences(Values=one_over_x_6)
quick_graph_11 = QuickGraph(relative_differences_5, SortOrder=0)
multiplication_2 = Multiplication(A=relative_differences_5, B=digit_scroller_25)
panel_19 = Panel(relative_differences_5)

point_3 = Point(curvature_5.Point)

line_sdl_6 = LineSDL(Start=point_3, Direction=line_3, Length=expr("-ABS(X)", multiplication_2))
evaluate_length_7 = EvaluateLength(Curve=line_sdl_6, Length=1, Normalized=True)  # -> Point, Tangent, Parameter
interpolate_4 = Interpolate(Vertices=evaluate_length_7.Point, Degree=3, Periodic=False, KnotStyle=2)  # -> Curve, Length, Domain

nurbs_curve_2 = NurbsCurve(Vertices=evaluate_length_7.Point, Degree=11, Periodic=False)  # -> Curve, Length, Domain
mirror_3 = Mirror(Geometry=[line_sdl_6, interpolate_4.Curve], Plane=xz_plane)  # -> Geometry, Transform
move_4 = Move(Geometry=mirror_3.Geometry, Motion=Vector(0, -2.5, 0))  # -> Geometry, Transform
bounding_box_5 = BoundingBox(Content=move_4.Geometry, Plane=PlaneXY(0, 0, 0), UnionBox=True)  # -> Box, Box_2
deconstruct_box_5 = DeconstructBox(Box=bounding_box_5.Box)  # -> Plane, X, Y, Z
deconstruct_domain_7 = DeconstructDomain(Domain=deconstruct_box_5.Y)  # -> Start, End
relative_differences_6 = RelativeDifferences(Values=[deconstruct_domain_7.Start, deconstruct_domain_7.End])
list_item_8 = ListItem(List=relative_differences_6, Index=1, Wrap=False)
panel_20 = Panel(list_item_8)
division_5 = Division(A=panel_20, B=panel_18)
panel_21 = Panel(division_5)

number_slider_17 = Slider(40, range=0..256)
number_12 = Number(number)
create_material_12 = CreateMaterial(Diffuse=RGB(232, 232, 232), Specular=RGB(0, 255, 255), Emission=RGB(0, 0, 0), Transparency=0.5, Shine=100)
create_material_13 = CreateMaterial(Diffuse=RGB(222, 222, 222), Specular=RGB(0, 255, 255), Emission=RGB(0, 0, 0), Transparency=0.5, Shine=100)
create_material_14 = CreateMaterial(Diffuse=RGB(196, 196, 196), Specular=RGB(0, 255, 255), Emission=RGB(0, 0, 0), Transparency=0.5, Shine=100)

digit_scroller_28 = DigitScroller(Scroller_Digits=12, Scroller_Prefix="Digit Scroller", Scroller_Radix=1, Scroller_Value=0.00190848809)
radians_2 = Radians(Degrees="0.001908488092445")
series_6 = Series(Start=0, Step=radians_2, Count=number_slider_6)

number_slider_18 = Slider(29, range=0..256)
number_13 = Number(number)

curve_graph_mapper = CurveGraphMapper(Curves=curve_3, Rectangle=rectangle.Rectangle, Values=series_6, Flip=False, Snap=False, TextSize=1)  # -> Mapped, GraphCurves, GraphPoints, ValueLines, ValuePoints, MappedLines, MappedPoints, Boundary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

turtle_2 = DotNETVBScriptLEGACY(Forward=duplicate_data, Left=curve_graph_mapper.Mapped)  # -> Output, Points; inputs Forward: list, Left: list; same code as turtle
point_4 = Point(turtle_2.Points)
interpolate_5 = Interpolate(Vertices=turtle_2.Points, Degree=3, Periodic=False, KnotStyle=0)  # -> Curve, Length, Domain

evaluate_length_8 = EvaluateLength(Curve=interpolate_5.Curve, Length=1, Normalized=True)  # -> Point, Tangent, Parameter
line_sdl_7 = LineSDL(Start=evaluate_length_8.Point, Direction=evaluate_length_8.Tangent, Length=1)
mirror_4 = Mirror(Geometry=interpolate_5.Curve, Plane=line_sdl_7)  # -> Geometry, Transform
join_curves_4 = JoinCurves(Curves=[interpolate_5.Curve, mirror_4.Geometry], Preserve=False)
end_points_2 = EndPoints(Curve=join_curves_4)  # -> Start, End
line_4 = Line(StartPoint=end_points_2.Start, EndPoint=end_points_2.End)
angle_6 = Angle(VectorA=Vector(1.4375, 0, 0), VectorB=line_4)  # -> Angle, Reflex
rotate_5 = Rotate(Geometry=join_curves_4, Angle=expr("-X", angle_6.Angle), Plane=evaluate_length_8.Point)  # -> Geometry, Transform
vector_2pt_3 = Vector2Pt(PointA=evaluate_length_8.Point, PointB=Point(0, 0, 0), Unitize=False)  # -> Vector, Length
move_5 = Move(Geometry=rotate_5.Geometry, Motion=vector_2pt_3.Vector)  # -> Geometry, Transform
curve_domain_2 = CurveDomain(Curve=move_5.Geometry)  # -> Curve, Domain
deconstruct_domain_8 = DeconstructDomain(Domain=curve_domain_2.Domain)  # -> Start, End
construct_domain_2 = ConstructDomain(DomainStart=expr("X/2", deconstruct_domain_8.End), DomainEnd=deconstruct_domain_8.End)
sub_curve_2 = SubCurve(BaseCurve=curve_domain_2.Curve, Domain=construct_domain_2)
evaluate_length_9 = EvaluateLength(Curve=sub_curve_2, Length=1, Normalized=True)  # -> Point, Tangent, Parameter
rotate_6 = Rotate(Geometry=sub_curve_2, Angle=3.141592654, Plane=evaluate_length_9.Point)  # -> Geometry, Transform
join_curves_5 = JoinCurves(Curves=[sub_curve_2, rotate_6.Geometry], Preserve=False)
bounding_box_6 = BoundingBox(Content=join_curves_5, Plane=PlaneXY(0, 0, 0), UnionBox=True)  # -> Box, Box_2
deconstruct_box_6 = DeconstructBox(Box=bounding_box_6.Box)  # -> Plane, X, Y, Z
scale_2 = Scale(Geometry=join_curves_5, Center=Point(0, 0, 0), Factor=expr("X^-1", deconstruct_box_6.X))  # -> Geometry, Transform
deconstruct_domain_9 = DeconstructDomain(Domain=deconstruct_box_6.X)  # -> Start, End
deconstruct_domain_10 = DeconstructDomain(Domain=deconstruct_box_6.Y)  # -> Start, End
mirror_5 = Mirror(Geometry=scale_2.Geometry, Plane=yz_plane)  # -> Geometry, Transform
division_6 = Division(A=deconstruct_domain_9.End, B=deconstruct_domain_10.End)
panel_22 = Panel(division_6)
curve_12 = Curve(mirror_5.Geometry)

curve_13 = Curve(curve_12)
divide_curve_6 = DivideCurve(Curve=curve_13, Count=number_10, Kinks=False)  # -> Points, Tangents, Parameters
curvature_6 = Curvature(Curve=curve_13, Parameter=divide_curve_6.Parameters)  # -> Point, Curvature, Curvature_2
deconstruct_arc_6 = DeconstructArc(Arc=curvature_6.Curvature_2)  # -> BasePlane, Radius, Angle
one_over_x_7 = OneOverX(Value=deconstruct_arc_6.Radius)
quick_graph_12 = QuickGraph(one_over_x_7, SortOrder=0)

relative_differences_7 = RelativeDifferences(Values=one_over_x_7)
panel_23 = Panel(relative_differences_7)
quick_graph_13 = QuickGraph(panel_23, SortOrder=0)

relative_differences_8 = RelativeDifferences(Values=relative_differences_7)
panel_24 = Panel(relative_differences_8)
quick_graph_14 = QuickGraph(panel_24, SortOrder=0)

relative_differences_9 = RelativeDifferences(Values=relative_differences_8)
panel_25 = Panel(relative_differences_9)
quick_graph_15 = QuickGraph(panel_25, SortOrder=0)

curvature_graph_6 = CurvatureGraph(Curve=curve_13, Density=1, Scale=digit_scroller_26)
construct_point_5 = ConstructPoint(XCoordinate=series_5, YCoordinate=expr("X/2", one_over_x_7), ZCoordinate=0)
polyline_4 = PolyLine(Vertices=construct_point_5, Closed=False)
quick_graph_16 = QuickGraph(one_over_x_7, SortOrder=0)
explode_4 = Explode(Curve=polyline_4, Recursive=True)  # -> Segments, Vertices
list_length_4 = ListLength(List=explode_4.Segments)  # -> expr("X/4", Length)
list_item_9 = ListItem(List=explode_4.Segments, Index=expr("X+(X/2)", list_length_4), Wrap=False)
list_item_10 = ListItem(List=explode_4.Segments, Index=expr("X-(X/2)", list_length_4), Wrap=False)
angle_7 = Angle(VectorA=list_item_9, VectorB=list_item_10)  # -> Angle, Reflex
expression_4 = Expression(X=angle_7.Angle, Expression="Format(\"{0:R}\", x)")
degrees_5 = Degrees(Radians=angle_7.Angle)
panel_26 = Panel(degrees_5)

curve_14 = Curve(curve_13)

curve_15 = Curve(graft([curve_7, curve_14]))
divide_curve_7 = DivideCurve(Curve=curve_15, Count=number_12, Kinks=False)  # -> Points, Tangents, Parameters
curvature_7 = Curvature(Curve=curve_15, Parameter=divide_curve_7.Parameters)  # -> Point, Curvature, Curvature_2
deconstruct_arc_7 = DeconstructArc(Arc=curvature_7.Curvature_2)  # -> BasePlane, Radius, Angle
line_5 = Line(StartPoint=curvature_7.Point, EndPoint=deconstruct_arc_7.BasePlane)
one_over_x_8 = OneOverX(Value=deconstruct_arc_7.Radius)
panel_27 = Panel(one_over_x_8)
quick_graph_17 = QuickGraph(one_over_x_8, SortOrder=0)
multiplication_3 = Multiplication(A=one_over_x_8, B=Slider(0.088888, range=0..0.5))
line_sdl_8 = LineSDL(Start=curvature_7.Point, Direction=line_5, Length=expr("-ABS(X)", multiplication_3))
evaluate_length_10 = EvaluateLength(Curve=line_sdl_8, Length=1, Normalized=True)  # -> Point, Tangent, Parameter
interpolate_6 = Interpolate(Vertices=evaluate_length_10.Point, Degree=3, Periodic=False, KnotStyle=2)  # -> Curve, Length, Domain
custom_preview_3 = CustomPreview(Geometry=curve_15, Material=create_material_14)
custom_preview_4 = CustomPreview(Geometry=line_sdl_8, Material=create_material_12)
custom_preview_5 = CustomPreview(Geometry=interpolate_6.Curve, Material=create_material_13)

relative_differences_10 = RelativeDifferences(Values=one_over_x_8)

derivatives = Derivatives(Curve=curve_15, Parameter=divide_curve_7.Parameters)  # -> Point, FirstDerivative, SecondDerivative, ThirdDerivative, FourthDerivative, FifthDerivative, SixthDerivative
panel_28 = Panel(relative_differences_10)
quick_graph_18 = QuickGraph(relative_differences_10, SortOrder=0)
multiplication_4 = Multiplication(A=relative_differences_10, B=digit_scroller_4)
line_sdl_9 = LineSDL(Start=evaluate_length_10.Point, Direction=line_5, Length=expr("-ABS(X)", multiplication_4))
evaluate_length_11 = EvaluateLength(Curve=line_sdl_9, Length=1, Normalized=True)  # -> Point, Tangent, Parameter
line_sdl_10 = LineSDL(Start=evaluate_length_11.Point, Direction=derivatives.ThirdDerivative, Length=expr("-X", multiplication_4))
custom_preview_6 = CustomPreview(Geometry=line_sdl_10, Material=create_material_9)
interpolate_7 = Interpolate(Vertices=evaluate_length_11.Point, Degree=3, Periodic=False, KnotStyle=2)  # -> Curve, Length, Domain
curve_16 = Curve(interpolate_6.Curve)
divide_curve_8 = DivideCurve(Curve=curve_16, Count=number_9, Kinks=False)  # -> Points, Tangents, Parameters
curvature_8 = Curvature(Curve=curve_16, Parameter=divide_curve_8.Parameters)  # -> Point, Curvature, Curvature_2
deconstruct_arc_8 = DeconstructArc(Arc=curvature_8.Curvature_2)  # -> BasePlane, Radius, Angle
one_over_x_9 = OneOverX(Value=deconstruct_arc_8.Radius)
line_6 = Line(StartPoint=curvature_8.Point, EndPoint=deconstruct_arc_8.BasePlane)
custom_preview_7 = CustomPreview(Geometry=interpolate_7.Curve, Material=create_material_10)
custom_preview_8 = CustomPreview(Geometry=line_sdl_9, Material=create_material_11)

evaluate_length_12 = EvaluateLength(Curve=line_sdl_10, Length=1, Normalized=True)  # -> Point, Tangent, Parameter
interpolate_8 = Interpolate(Vertices=evaluate_length_12.Point, Degree=3, Periodic=False, KnotStyle=2)  # -> Curve, Length, Domain
nurbs_curve_3 = NurbsCurve(Vertices=evaluate_length_12.Point, Degree=11, Periodic=False)  # -> Curve, Length, Domain
nurbs_curve_4 = NurbsCurve(Vertices=evaluate_length_11.Point, Degree=11, Periodic=False)  # -> Curve, Length, Domain
nurbs_curve_5 = NurbsCurve(Vertices=evaluate_length_10.Point, Degree=11, Periodic=False)  # -> Curve, Length, Domain
merge = Merge(Data1=evaluate_length_11.Point)

polyline_5 = PolyLine(Vertices=curvature_7.Point, Closed=False)
explode_5 = Explode(Curve=polyline_5, Recursive=True)  # -> Segments, Vertices
curve_17 = Curve(flatten(explode_5.Segments))
length = Length(Curve=curve_17)
sort_list = SortList(Keys=length, ValuesValuesA=curve_17)  # -> Keys, ValuesValuesA
panel_29 = Panel(sort_list.Keys)
list_item_11 = ListItem(List=sort_list.Keys, Index=0, Wrap=False)

curve_18 = Curve(interpolate_6.Curve)
divide_curve_9 = DivideCurve(Curve=curve_18, Count=number_11, Kinks=False)  # -> Points, Tangents, Parameters
curvature_9 = Curvature(Curve=curve_18, Parameter=divide_curve_9.Parameters)  # -> Point, Curvature, Curvature_2
deconstruct_arc_9 = DeconstructArc(Arc=curvature_9.Curvature_2)  # -> BasePlane, Radius, Angle
one_over_x_10 = OneOverX(Value=deconstruct_arc_9.Radius)
panel_30 = Panel(one_over_x_10)
quick_graph_19 = QuickGraph(one_over_x_10, SortOrder=0)
line_7 = Line(StartPoint=curvature_9.Point, EndPoint=deconstruct_arc_9.BasePlane)
multiplication_5 = Multiplication(A=one_over_x_10, B=Slider(0.043994, range=0..0.5))
line_sdl_11 = LineSDL(Start=evaluate_length_10.Point, Direction=line_5, Length=expr("-ABS(X)", multiplication_5))
evaluate_length_13 = EvaluateLength(Curve=line_sdl_11, Length=1, Normalized=True)  # -> Point, Tangent, Parameter
interpolate_9 = Interpolate(Vertices=evaluate_length_13.Point, Degree=3, Periodic=False, KnotStyle=2)  # -> Curve, Length, Domain

nurbs_curve_6 = NurbsCurve(Vertices=evaluate_length_13.Point, Degree=11, Periodic=False)  # -> Curve, Length, Domain
dot_display = DotDisplay(Point=merge, Colour=RGB(194, 194, 194), Size=expr("X/2", list_item_11))
merge_2 = Merge(Data1=curve_7, Data2=curve_14, Data3=curve_8, Data4=curve_9)  # -> flatten(Result)
mirror_6 = Mirror(Geometry=merge_2, Plane=xz_plane)  # -> Geometry, Transform
move_6 = Move(Geometry=mirror_6.Geometry, Motion=Vector(0, -2.5, 0))  # -> Geometry, Transform
length_2 = Length(Curve=line_sdl_8)
bounding_box_7 = BoundingBox(Content=[merge_2, line_sdl_10], Plane=PlaneXY(0, 0, 0), UnionBox=True)  # -> Box, Box_2
curve_19 = Curve(curve_15)  # disabled
sort_list_2 = SortList(Keys=length_2, ValuesValuesA=line_sdl_8)  # -> reverse(Keys), reverse(ValuesValuesA)
deconstruct_box_7 = DeconstructBox(Box=bounding_box_7.Box)  # -> Plane, X, Y, Z
deconstruct_domain_11 = DeconstructDomain(Domain=deconstruct_box_7.Y)  # -> Start, End
list_item_12 = ListItem(List=sort_list_2.ValuesValuesA, Index=0, Wrap=False)
construct_domain_3 = ConstructDomain(DomainStart=expr("X*1.0971875", deconstruct_domain_11.Start), DomainEnd=expr("X*1.275", deconstruct_domain_11.End))
interpolate_10 = Interpolate(Vertices=construct_point_5, Degree=3, Periodic=False, KnotStyle=1)  # -> Curve, Length, Domain
mirror_7 = Mirror(Geometry=merge_2, Plane=xz_plane_2)  # -> Geometry, Transform
move_7 = Move(Geometry=mirror_7.Geometry, Motion=Vector(0, -2.5, 0))  # -> Geometry, Transform
panel_31 = Panel(list_item_12)
rectangle_2 = Rectangle(Plane=PlaneXY(0, 0, 0), XSize=deconstruct_box_7.X, YSize=construct_domain_3, Radius=0)  # -> Rectangle, Length
bounding_box_8 = BoundingBox(Content=interpolate_10.Curve, Plane=PlaneXY(0, 0, 0))  # -> Box, Box_2
deconstruct_box_8 = DeconstructBox(Box=bounding_box_8.Box)  # -> Plane, X, Y, Z
deconstruct_domain_12 = DeconstructDomain(Domain=deconstruct_box_8.X)  # -> Start, End
deconstruct_domain_13 = DeconstructDomain(Domain=deconstruct_box_8.Y)  # -> Start, End
scale_nu_3 = ScaleNU(
    Geometry=interpolate_10.Curve,
    Plane=PlaneXY(0, 0, 0),
    ScaleX=expr("1/X", deconstruct_domain_12.End),
    ScaleY=expr(".5/X", deconstruct_domain_13.End),
    ScaleZ=1)  # -> Geometry, Transform
move_8 = Move(Geometry=scale_nu_3.Geometry, Motion=vector_2pt_2.Vector)  # -> Geometry, Transform
move_9 = Move(Geometry=move_8.Geometry, Motion=Vector(0, -1, 0))  # -> Geometry, Transform

mirror_8 = Mirror(Geometry=curve_12, Plane=yz_plane)  # -> Geometry, Transform
scale_nu_4 = ScaleNU(Geometry=[curve_12, mirror_8.Geometry], Plane=PlaneXY(0, 0, 0), ScaleX=0.5, ScaleY=expr("-X", 0.5), ScaleZ=1)  # -> Geometry, Transform
move_10 = Move(Geometry=scale_nu_4.Geometry, Motion=Vector(2, -0.5, 0))  # -> Geometry, Transform

curve_20 = Curve([curve_7, curve_14])
divide_curve_10 = DivideCurve(Curve=curve_20, Count=number_13, Kinks=False)  # -> Points, Tangents, Parameters
curvature_10 = Curvature(Curve=curve_20, Parameter=divide_curve_10.Parameters)  # -> Point, Curvature, Curvature_2
deconstruct_arc_10 = DeconstructArc(Arc=curvature_10.Curvature_2)  # -> BasePlane, Radius, Angle
line_8 = Line(StartPoint=curvature_10.Point, EndPoint=deconstruct_arc_10.BasePlane)
one_over_x_11 = OneOverX(Value=deconstruct_arc_10.Radius)
relative_differences_11 = RelativeDifferences(Values=one_over_x_11)
quick_graph_20 = QuickGraph(relative_differences_11, SortOrder=0)
multiplication_6 = Multiplication(A=relative_differences_11, B=digit_scroller_5)
panel_32 = Panel(relative_differences_11)

point_5 = Point(curvature_10.Point)

line_sdl_12 = LineSDL(Start=point_5, Direction=line_8, Length=expr("-ABS(X)", multiplication_6))
evaluate_length_14 = EvaluateLength(Curve=line_sdl_12, Length=1, Normalized=True)  # -> Point, Tangent, Parameter
interpolate_11 = Interpolate(Vertices=evaluate_length_14.Point, Degree=3, Periodic=False, KnotStyle=2)  # -> Curve, Length, Domain

length_3 = Length(Curve=line_sdl_12)
sort_list_3 = SortList(Keys=length_3, ValuesValuesA=line_sdl_12)  # -> reverse(Keys), reverse(ValuesValuesA)
nurbs_curve_7 = NurbsCurve(Vertices=evaluate_length_14.Point, Degree=11, Periodic=False)  # -> Curve, Length, Domain
list_item_13 = ListItem(List=sort_list_3.ValuesValuesA, Index=0, Wrap=False)
panel_33 = Panel(list_item_13)
division_7 = Division(A=sort_list_3.Keys, B=sort_list_2.Keys)
panel_34 = Panel(division_7)
mirror_9 = Mirror(Geometry=[line_sdl_12, interpolate_11.Curve], Plane=xz_plane_2)  # -> Geometry, Transform
move_11 = Move(Geometry=mirror_9.Geometry, Motion=Vector(0, -2.5, 0))  # -> Geometry, Transform
merge_3 = Merge(Data1=interpolate_6.Curve, Data2=move_11.Geometry)  # -> flatten(Result)
bounding_box_9 = BoundingBox(Content=merge_3, Plane=PlaneXY(0, 0, 0), UnionBox=True)  # -> Box, Box_2

number_slider_19 = Slider(29, range=0..256)
number_14 = Number(number)
curve_21 = Curve(curve_19)
divide_curve_11 = DivideCurve(Curve=curve_21, Count=number_14, Kinks=False)  # -> Points, Tangents, Parameters
curvature_11 = Curvature(Curve=curve_21, Parameter=divide_curve_11.Parameters)  # -> Point, Curvature, Curvature_2
deconstruct_arc_11 = DeconstructArc(Arc=curvature_11.Curvature_2)  # -> BasePlane, Radius, Angle
line_9 = Line(StartPoint=curvature_11.Point, EndPoint=deconstruct_arc_11.BasePlane)
one_over_x_12 = OneOverX(Value=deconstruct_arc_11.Radius)

relative_differences_12 = RelativeDifferences(Values=one_over_x_12)
move_12 = Move(Geometry=curvature_11.Point, Motion=Vector(0, 2.5, 0))  # -> Geometry, Transform

relative_differences_13 = RelativeDifferences(Values=relative_differences_12)
quick_graph_21 = QuickGraph(relative_differences_13, SortOrder=0)
multiplication_7 = Multiplication(A=relative_differences_13, B=Slider(9.996405, range=0..16))
line_sdl_13 = LineSDL(Start=move_12.Geometry, Direction=line_9, Length=expr("-ABS(X)", multiplication_7))
evaluate_length_15 = EvaluateLength(Curve=line_sdl_13, Length=1, Normalized=True)  # -> Point, Tangent, Parameter
interpolate_12 = Interpolate(Vertices=evaluate_length_15.Point, Degree=3, Periodic=False, KnotStyle=2)  # -> Curve, Length, Domain
panel_35 = Panel(relative_differences_13)

bounds = Bounds(Numbers=relative_differences_13)
remap_numbers = RemapNumbers(Value=relative_differences_13, Source=bounds, Target=Domain(-1, 1))  # -> Mapped, Clipped
nurbs_curve_8 = NurbsCurve(Vertices=evaluate_length_15.Point, Degree=11, Periodic=False)  # -> Curve, Length, Domain
move_13 = Move(Geometry=curve_21, Motion=Vector(0, 2.5, 0))  # -> Geometry, Transform

number_slider_20 = Slider(29, range=0..256)
number_15 = Number(number)
curve_22 = Curve(curve_19)
divide_curve_12 = DivideCurve(Curve=curve_22, Count=number_15, Kinks=False)  # -> Points, Tangents, Parameters
curvature_12 = Curvature(Curve=curve_22, Parameter=divide_curve_12.Parameters)  # -> Point, Curvature, Curvature_2
deconstruct_arc_12 = DeconstructArc(Arc=curvature_12.Curvature_2)  # -> BasePlane, Radius, Angle
line_10 = Line(StartPoint=curvature_12.Point, EndPoint=deconstruct_arc_12.BasePlane)
one_over_x_13 = OneOverX(Value=deconstruct_arc_12.Radius)

relative_differences_14 = RelativeDifferences(Values=one_over_x_13)
relative_differences_15 = RelativeDifferences(Values=relative_differences_14)
move_14 = Move(Geometry=curvature_12.Point, Motion=Vector(0, 3.5, 0))  # -> Geometry, Transform

relative_differences_16 = RelativeDifferences(Values=relative_differences_15)
quick_graph_22 = QuickGraph(relative_differences_16, SortOrder=0)
multiplication_8 = Multiplication(A=relative_differences_16, B=Slider(11.450938, range=0..16))
line_sdl_14 = LineSDL(Start=move_14.Geometry, Direction=line_10, Length=expr("-ABS(X)", multiplication_8))
evaluate_length_16 = EvaluateLength(Curve=line_sdl_14, Length=1, Normalized=True)  # -> Point, Tangent, Parameter
interpolate_13 = Interpolate(Vertices=evaluate_length_16.Point, Degree=3, Periodic=False, KnotStyle=2)  # -> Curve, Length, Domain
panel_36 = Panel(relative_differences_16)

bounds_2 = Bounds(Numbers=relative_differences_16)
remap_numbers_2 = RemapNumbers(Value=relative_differences_16, Source=bounds_2, Target=Domain(-1, 1))  # -> Mapped, Clipped
nurbs_curve_9 = NurbsCurve(Vertices=evaluate_length_16.Point, Degree=11, Periodic=False)  # -> Curve, Length, Domain
move_15 = Move(Geometry=curve_22, Motion=Vector(0, 3.5, 0))  # -> Geometry, Transform

number_slider_21 = Slider(29, range=0..256)
number_16 = Number(number)
curve_23 = Curve(curve_19)
divide_curve_13 = DivideCurve(Curve=curve_23, Count=number_16, Kinks=False)  # -> Points, Tangents, Parameters
curvature_13 = Curvature(Curve=curve_23, Parameter=divide_curve_13.Parameters)  # -> Point, Curvature, Curvature_2
deconstruct_arc_13 = DeconstructArc(Arc=curvature_13.Curvature_2)  # -> BasePlane, Radius, Angle
line_11 = Line(StartPoint=curvature_13.Point, EndPoint=deconstruct_arc_13.BasePlane)
one_over_x_14 = OneOverX(Value=deconstruct_arc_13.Radius)

relative_differences_17 = RelativeDifferences(Values=one_over_x_14)
relative_differences_18 = RelativeDifferences(Values=relative_differences_17)
relative_differences_19 = RelativeDifferences(Values=relative_differences_18)

relative_differences_20 = RelativeDifferences(Values=relative_differences_19)
quick_graph_23 = QuickGraph(relative_differences_20, SortOrder=0)
multiplication_9 = Multiplication(A=relative_differences_20, B=Slider(4, range=0..4))
line_sdl_15 = LineSDL(Start=curvature_13.Point, Direction=line_11, Length=expr("-ABS(X)", multiplication_9))
evaluate_length_17 = EvaluateLength(Curve=line_sdl_15, Length=1, Normalized=True)  # -> Point, Tangent, Parameter
interpolate_14 = Interpolate(Vertices=evaluate_length_17.Point, Degree=3, Periodic=False, KnotStyle=2)  # -> Curve, Length, Domain
panel_37 = Panel(relative_differences_20)

nurbs_curve_10 = NurbsCurve(Vertices=evaluate_length_17.Point, Degree=11, Periodic=False)  # -> Curve, Length, Domain

panel_38 = Panel("""16                
32                
64                
128              
256              0.0019131912207""")
division_8 = Division(A=0.4964279019, B=0.122908661)
curve_24 = Curve(scale_2.Geometry)
evaluate_length_18 = EvaluateLength(Curve=curve_12, Length=0, Normalized=True)  # -> Point, Tangent, Parameter
yz_plane_2 = YZPlane(Origin=evaluate_length_18.Point)
vector_2pt_4 = Vector2Pt(PointA=Point(0, 0, 0), PointB=evaluate_length_18.Point, Unitize=False)  # -> Vector, Length
create_material_15 = CreateMaterial(Diffuse=RGB(255, 105, 180), Specular=RGB(255, 255, 255), Emission=RGB(0, 0, 0), Transparency=0, Shine=0)

digit_scroller_29 = DigitScroller(Scroller_Digits=12, Scroller_Prefix="Digit Scroller", Scroller_Radix=1, Scroller_Value=0.00191319122)
radians_3 = Radians(Degrees="0.0019131912207")
series_7 = Series(Start=0, Step=radians_3, Count=number_slider_6)

curve_graph_mapper_2 = CurveGraphMapper(Curves=curve_24, Rectangle=rectangle.Rectangle, Values=series_7, Flip=False, Snap=False, TextSize=1)  # -> Mapped, GraphCurves, GraphPoints, ValueLines, ValuePoints, MappedLines, MappedPoints, Boundary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

turtle_3 = DotNETVBScriptLEGACY(Forward=duplicate_data, Left=curve_graph_mapper_2.Mapped)  # -> Output, Points; inputs Forward: list, Left: list; same code as turtle
point_6 = Point(turtle_3.Points)
interpolate_15 = Interpolate(Vertices=turtle_3.Points, Degree=3, Periodic=False, KnotStyle=0)  # -> Curve, Length, Domain

evaluate_length_19 = EvaluateLength(Curve=interpolate_15.Curve, Length=1, Normalized=True)  # -> Point, Tangent, Parameter
line_sdl_16 = LineSDL(Start=evaluate_length_19.Point, Direction=evaluate_length_19.Tangent, Length=1)
mirror_10 = Mirror(Geometry=interpolate_15.Curve, Plane=line_sdl_16)  # -> Geometry, Transform
join_curves_6 = JoinCurves(Curves=[interpolate_15.Curve, mirror_10.Geometry], Preserve=False)
end_points_3 = EndPoints(Curve=join_curves_6)  # -> Start, End
line_12 = Line(StartPoint=end_points_3.Start, EndPoint=end_points_3.End)
angle_8 = Angle(VectorA=Vector(1.4375, 0, 0), VectorB=line_12)  # -> Angle, Reflex
rotate_7 = Rotate(Geometry=join_curves_6, Angle=expr("-X", angle_8.Angle), Plane=evaluate_length_19.Point)  # -> Geometry, Transform
vector_2pt_5 = Vector2Pt(PointA=evaluate_length_19.Point, PointB=Point(0, 0, 0), Unitize=False)  # -> Vector, Length
move_16 = Move(Geometry=rotate_7.Geometry, Motion=vector_2pt_5.Vector)  # -> Geometry, Transform
curve_domain_3 = CurveDomain(Curve=move_16.Geometry)  # -> Curve, Domain
deconstruct_domain_14 = DeconstructDomain(Domain=curve_domain_3.Domain)  # -> Start, End
construct_domain_4 = ConstructDomain(DomainStart=expr("X/2", deconstruct_domain_14.End), DomainEnd=deconstruct_domain_14.End)
sub_curve_3 = SubCurve(BaseCurve=curve_domain_3.Curve, Domain=construct_domain_4)
evaluate_length_20 = EvaluateLength(Curve=sub_curve_3, Length=1, Normalized=True)  # -> Point, Tangent, Parameter
rotate_8 = Rotate(Geometry=sub_curve_3, Angle=3.141592654, Plane=evaluate_length_20.Point)  # -> Geometry, Transform
join_curves_7 = JoinCurves(Curves=[sub_curve_3, rotate_8.Geometry], Preserve=False)
bounding_box_10 = BoundingBox(Content=join_curves_7, Plane=PlaneXY(0, 0, 0), UnionBox=True)  # -> Box, Box_2
deconstruct_box_9 = DeconstructBox(Box=bounding_box_10.Box)  # -> Plane, X, Y, Z
scale_3 = Scale(Geometry=join_curves_7, Center=Point(0, 0, 0), Factor=expr("X^-1", deconstruct_box_9.X))  # -> Geometry, Transform
deconstruct_domain_15 = DeconstructDomain(Domain=deconstruct_box_9.X)  # -> Start, End
deconstruct_domain_16 = DeconstructDomain(Domain=deconstruct_box_9.Y)  # -> Start, End
division_9 = Division(A=deconstruct_domain_15.End, B=deconstruct_domain_16.End)
panel_42 = Panel(division_9)

move_17 = Move(Geometry=scale_3.Geometry, Motion=vector_2pt_4.Vector)  # -> Geometry, Transform

curve_25 = Curve(move_17.Geometry)
custom_preview_9 = CustomPreview(Geometry=curve_25, Material=create_material_15)

number_slider_22 = Slider(40, range=0..256)
curve_26 = Curve(curve_25)
number_17 = Number(number)
divide_curve_14 = DivideCurve(Curve=curve_26, Count=number_17, Kinks=False)  # -> Points, Tangents, Parameters
curvature_14 = Curvature(Curve=curve_26, Parameter=divide_curve_14.Parameters)  # -> Point, Curvature, Curvature_2
deconstruct_arc_14 = DeconstructArc(Arc=curvature_14.Curvature_2)  # -> BasePlane, Radius, Angle
line_13 = Line(StartPoint=curvature_14.Point, EndPoint=deconstruct_arc_14.BasePlane)
one_over_x_15 = OneOverX(Value=deconstruct_arc_14.Radius)
panel_43 = Panel(one_over_x_15)
quick_graph_24 = QuickGraph(one_over_x_15, SortOrder=0)
multiplication_10 = Multiplication(A=one_over_x_15, B=Slider(0.088888, range=0..0.5))
line_sdl_17 = LineSDL(Start=curvature_14.Point, Direction=line_13, Length=expr("-ABS(X)", multiplication_10))
evaluate_length_21 = EvaluateLength(Curve=line_sdl_17, Length=1, Normalized=True)  # -> Point, Tangent, Parameter
interpolate_16 = Interpolate(Vertices=evaluate_length_21.Point, Degree=3, Periodic=False, KnotStyle=2)  # -> Curve, Length, Domain
create_material_16 = CreateMaterial(Diffuse=RGB(232, 232, 232), Specular=RGB(0, 255, 255), Emission=RGB(0, 0, 0), Transparency=0.5, Shine=100)
create_material_17 = CreateMaterial(Diffuse=RGB(222, 222, 222), Specular=RGB(0, 255, 255), Emission=RGB(0, 0, 0), Transparency=0.5, Shine=100)
create_material_18 = CreateMaterial(Diffuse=RGB(199, 199, 199), Specular=RGB(0, 255, 255), Emission=RGB(0, 0, 0), Transparency=0.5, Shine=100)
custom_preview_10 = CustomPreview(Geometry=curve_26, Material=create_material_18)
custom_preview_11 = CustomPreview(Geometry=line_sdl_17, Material=create_material_16)
custom_preview_12 = CustomPreview(Geometry=interpolate_16.Curve, Material=create_material_17)

relative_differences_21 = RelativeDifferences(Values=one_over_x_15)

create_material_19 = CreateMaterial(Diffuse=RGB(235, 235, 235), Specular=RGB(0, 255, 255), Emission=RGB(0, 0, 0), Transparency=0.5, Shine=100)
derivatives_2 = Derivatives(Curve=curve_26, Parameter=divide_curve_14.Parameters)  # -> Point, FirstDerivative, SecondDerivative, ThirdDerivative, FourthDerivative, FifthDerivative, SixthDerivative
panel_44 = Panel(relative_differences_21)
number_slider_23 = Slider(42, range=0..256)
quick_graph_25 = QuickGraph(relative_differences_21, SortOrder=0)
multiplication_11 = Multiplication(A=relative_differences_21, B=digit_scroller_7)
line_sdl_18 = LineSDL(Start=evaluate_length_21.Point, Direction=derivatives_2.SecondDerivative, Length=expr("-ABS(X)", multiplication_11))
evaluate_length_22 = EvaluateLength(Curve=line_sdl_18, Length=1, Normalized=True)  # -> Point, Tangent, Parameter
line_sdl_19 = LineSDL(Start=evaluate_length_22.Point, Direction=derivatives_2.ThirdDerivative, Length=expr("-X", multiplication_11))
custom_preview_13 = CustomPreview(Geometry=line_sdl_19, Material=create_material_19)
interpolate_17 = Interpolate(Vertices=evaluate_length_22.Point, Degree=3, Periodic=False, KnotStyle=2)  # -> Curve, Length, Domain
curve_27 = Curve(interpolate_16.Curve)
number_18 = Number(number)
divide_curve_15 = DivideCurve(Curve=curve_27, Count=number_18, Kinks=False)  # -> Points, Tangents, Parameters
curvature_15 = Curvature(Curve=curve_27, Parameter=divide_curve_15.Parameters)  # -> Point, Curvature, Curvature_2
deconstruct_arc_15 = DeconstructArc(Arc=curvature_15.Curvature_2)  # -> BasePlane, Radius, Angle
one_over_x_16 = OneOverX(Value=deconstruct_arc_15.Radius)
line_14 = Line(StartPoint=curvature_15.Point, EndPoint=deconstruct_arc_15.BasePlane)
create_material_20 = CreateMaterial(Diffuse=RGB(224, 224, 224), Specular=RGB(0, 255, 255), Emission=RGB(0, 0, 0), Transparency=0.5, Shine=100)
create_material_21 = CreateMaterial(Diffuse=RGB(242, 242, 242), Specular=RGB(0, 255, 255), Emission=RGB(0, 0, 0), Transparency=0.5, Shine=100)
custom_preview_14 = CustomPreview(Geometry=interpolate_17.Curve, Material=create_material_20)
custom_preview_15 = CustomPreview(Geometry=line_sdl_18, Material=create_material_21)

evaluate_length_23 = EvaluateLength(Curve=line_sdl_19, Length=1, Normalized=True)  # -> Point, Tangent, Parameter
interpolate_18 = Interpolate(Vertices=evaluate_length_23.Point, Degree=3, Periodic=False, KnotStyle=2)  # -> Curve, Length, Domain
nurbs_curve_11 = NurbsCurve(Vertices=evaluate_length_23.Point, Degree=11, Periodic=False)  # -> Curve, Length, Domain
nurbs_curve_12 = NurbsCurve(Vertices=evaluate_length_22.Point, Degree=11, Periodic=False)  # -> Curve, Length, Domain
nurbs_curve_13 = NurbsCurve(Vertices=evaluate_length_21.Point, Degree=11, Periodic=False)  # -> Curve, Length, Domain
merge_4 = Merge(Data1=evaluate_length_22.Point)

polyline_6 = PolyLine(Vertices=curvature_14.Point, Closed=False)
explode_6 = Explode(Curve=polyline_6, Recursive=True)  # -> Segments, Vertices
curve_28 = Curve(flatten(explode_6.Segments))
length_4 = Length(Curve=curve_28)
sort_list_4 = SortList(Keys=length_4, ValuesValuesA=curve_28)  # -> Keys, ValuesValuesA
panel_45 = Panel(sort_list_4.Keys)
list_item_14 = ListItem(List=sort_list_4.Keys, Index=0, Wrap=False)

dot_display_2 = DotDisplay(Point=merge_4, Colour=RGB(194, 194, 194), Size=expr("X/2", list_item_14))
length_5 = Length(Curve=line_sdl_17)
sort_list_5 = SortList(Keys=length_5, ValuesValuesA=line_sdl_17)  # -> reverse(Keys), reverse(ValuesValuesA)
list_item_15 = ListItem(List=sort_list_5.ValuesValuesA, Index=0, Wrap=False)
panel_46 = Panel(list_item_15)

number_slider_24 = Slider(29, range=0..256)
number_19 = Number(number)
curve_29 = Curve(curve_25)  # disabled
divide_curve_16 = DivideCurve(Curve=curve_29, Count=number_19, Kinks=False)  # -> Points, Tangents, Parameters
curvature_16 = Curvature(Curve=curve_29, Parameter=divide_curve_16.Parameters)  # -> Point, Curvature, Curvature_2
deconstruct_arc_16 = DeconstructArc(Arc=curvature_16.Curvature_2)  # -> BasePlane, Radius, Angle
line_15 = Line(StartPoint=curvature_16.Point, EndPoint=deconstruct_arc_16.BasePlane)
one_over_x_17 = OneOverX(Value=deconstruct_arc_16.Radius)

derivatives_3 = Derivatives(Curve=curve_29, Parameter=divide_curve_16.Parameters)  # -> Point, FirstDerivative, SecondDerivative, ThirdDerivative, FourthDerivative, FifthDerivative, SixthDerivative
relative_differences_22 = RelativeDifferences(Values=one_over_x_17)
point_7 = Point(curvature_16.Point)

relative_differences_23 = RelativeDifferences(Values=relative_differences_22)
quick_graph_26 = QuickGraph(relative_differences_22, SortOrder=0)
multiplication_12 = Multiplication(A=relative_differences_22, B=digit_scroller_8)
line_sdl_20 = LineSDL(Start=point_7, Direction=line_15, Length=expr("-ABS(X)", multiplication_12))
evaluate_length_24 = EvaluateLength(Curve=line_sdl_20, Length=1, Normalized=True)  # -> Point, Tangent, Parameter
interpolate_19 = Interpolate(Vertices=evaluate_length_24.Point, Degree=3, Periodic=False, KnotStyle=2)  # -> Curve, Length, Domain
panel_47 = Panel(relative_differences_22)

length_6 = Length(Curve=line_sdl_20)
sort_list_6 = SortList(Keys=length_6, ValuesValuesA=line_sdl_20)  # -> reverse(Keys), reverse(ValuesValuesA)
nurbs_curve_14 = NurbsCurve(Vertices=evaluate_length_24.Point, Degree=11, Periodic=False)  # -> Curve, Length, Domain
list_item_16 = ListItem(List=sort_list_6.ValuesValuesA, Index=0, Wrap=False)
panel_48 = Panel(list_item_16)
division_10 = Division(A=sort_list_6.Keys, B=sort_list_5.Keys)
panel_49 = Panel(division_10)
custom_preview_16 = CustomPreview(Geometry=line_sdl_20, Material=create_material)

panel_51 = Panel("""16                
32                
64                
128              
256              0.00191294160505""")
division_11 = Division(A=0.4964279019, B=0.122908661)
curve_30 = Curve(scale_3.Geometry)
evaluate_length_25 = EvaluateLength(Curve=curve_12, Length=0, Normalized=True)  # -> Point, Tangent, Parameter
vector_2pt_6 = Vector2Pt(PointA=Point(0, 0, 0), PointB=evaluate_length_25.Point, Unitize=False)  # -> Vector, Length
create_material_22 = CreateMaterial(Diffuse=RGB(255, 105, 180), Specular=RGB(255, 255, 255), Emission=RGB(0, 0, 0), Transparency=0, Shine=0)

digit_scroller_30 = DigitScroller(Scroller_Digits=12, Scroller_Prefix="Digit Scroller", Scroller_Radix=1, Scroller_Value=0.0019129416)
radians_4 = Radians(Degrees="0.00191294160505")
series_8 = Series(Start=0, Step=radians_4, Count=number_slider_6)

curve_graph_mapper_3 = CurveGraphMapper(Curves=curve_30, Rectangle=rectangle.Rectangle, Values=series_8, Flip=False, Snap=False, TextSize=1)  # -> Mapped, GraphCurves, GraphPoints, ValueLines, ValuePoints, MappedLines, MappedPoints, Boundary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

turtle_4 = DotNETVBScriptLEGACY(Forward=duplicate_data, Left=curve_graph_mapper_3.Mapped)  # -> Output, Points; inputs Forward: list, Left: list; same code as turtle
point_8 = Point(turtle_4.Points)
interpolate_20 = Interpolate(Vertices=turtle_4.Points, Degree=3, Periodic=False, KnotStyle=0)  # -> Curve, Length, Domain

evaluate_length_26 = EvaluateLength(Curve=interpolate_20.Curve, Length=1, Normalized=True)  # -> Point, Tangent, Parameter
line_sdl_21 = LineSDL(Start=evaluate_length_26.Point, Direction=evaluate_length_26.Tangent, Length=1)
mirror_11 = Mirror(Geometry=interpolate_20.Curve, Plane=line_sdl_21)  # -> Geometry, Transform
join_curves_8 = JoinCurves(Curves=[interpolate_20.Curve, mirror_11.Geometry], Preserve=False)
end_points_4 = EndPoints(Curve=join_curves_8)  # -> Start, End
line_16 = Line(StartPoint=end_points_4.Start, EndPoint=end_points_4.End)
angle_9 = Angle(VectorA=Vector(1.4375, 0, 0), VectorB=line_16)  # -> Angle, Reflex
rotate_9 = Rotate(Geometry=join_curves_8, Angle=expr("-X", angle_9.Angle), Plane=evaluate_length_26.Point)  # -> Geometry, Transform
vector_2pt_7 = Vector2Pt(PointA=evaluate_length_26.Point, PointB=Point(0, 0, 0), Unitize=False)  # -> Vector, Length
move_18 = Move(Geometry=rotate_9.Geometry, Motion=vector_2pt_7.Vector)  # -> Geometry, Transform
curve_domain_4 = CurveDomain(Curve=move_18.Geometry)  # -> Curve, Domain
deconstruct_domain_17 = DeconstructDomain(Domain=curve_domain_4.Domain)  # -> Start, End
construct_domain_5 = ConstructDomain(DomainStart=expr("X/2", deconstruct_domain_17.End), DomainEnd=deconstruct_domain_17.End)
sub_curve_4 = SubCurve(BaseCurve=curve_domain_4.Curve, Domain=construct_domain_5)
evaluate_length_27 = EvaluateLength(Curve=sub_curve_4, Length=1, Normalized=True)  # -> Point, Tangent, Parameter
rotate_10 = Rotate(Geometry=sub_curve_4, Angle=3.141592654, Plane=evaluate_length_27.Point)  # -> Geometry, Transform
join_curves_9 = JoinCurves(Curves=[sub_curve_4, rotate_10.Geometry], Preserve=False)
bounding_box_11 = BoundingBox(Content=join_curves_9, Plane=PlaneXY(0, 0, 0), UnionBox=True)  # -> Box, Box_2
deconstruct_box_10 = DeconstructBox(Box=bounding_box_11.Box)  # -> Plane, X, Y, Z
scale_4 = Scale(Geometry=join_curves_9, Center=Point(0, 0, 0), Factor=expr("X^-1", deconstruct_box_10.X))  # -> Geometry, Transform
mirror_12 = Mirror(Geometry=scale_4.Geometry, Plane=yz_plane)  # -> Geometry, Transform
move_19 = Move(Geometry=mirror_12.Geometry, Motion=vector_2pt_6.Vector)  # -> Geometry, Transform
curve_31 = Curve(move_19.Geometry)
deconstruct_domain_18 = DeconstructDomain(Domain=deconstruct_box_10.X)  # -> Start, End
deconstruct_domain_19 = DeconstructDomain(Domain=deconstruct_box_10.Y)  # -> Start, End
custom_preview_17 = CustomPreview(Geometry=curve_31, Material=create_material_22)
division_12 = Division(A=deconstruct_domain_18.End, B=deconstruct_domain_19.End)
panel_55 = Panel(division_12)

evaluate_length_28 = EvaluateLength(Curve=move_19.Geometry, Length=1, Normalized=True)  # -> Point, Tangent, Parameter

number_slider_25 = Slider(40, range=0..256)
curve_32 = Curve(curve_31)
number_20 = Number(number)
divide_curve_17 = DivideCurve(Curve=curve_32, Count=number_20, Kinks=False)  # -> Points, Tangents, Parameters
curvature_17 = Curvature(Curve=curve_32, Parameter=divide_curve_17.Parameters)  # -> Point, Curvature, Curvature_2
deconstruct_arc_17 = DeconstructArc(Arc=curvature_17.Curvature_2)  # -> BasePlane, Radius, Angle
line_17 = Line(StartPoint=curvature_17.Point, EndPoint=deconstruct_arc_17.BasePlane)
one_over_x_18 = OneOverX(Value=deconstruct_arc_17.Radius)
panel_56 = Panel(one_over_x_18)
quick_graph_27 = QuickGraph(one_over_x_18, SortOrder=0)
multiplication_13 = Multiplication(A=one_over_x_18, B=Slider(0.088888, range=0..0.5))
line_sdl_22 = LineSDL(Start=curvature_17.Point, Direction=line_17, Length=expr("-ABS(X)", multiplication_13))
evaluate_length_29 = EvaluateLength(Curve=line_sdl_22, Length=1, Normalized=True)  # -> Point, Tangent, Parameter
interpolate_21 = Interpolate(Vertices=evaluate_length_29.Point, Degree=3, Periodic=False, KnotStyle=2)  # -> Curve, Length, Domain
create_material_23 = CreateMaterial(Diffuse=RGB(232, 232, 232), Specular=RGB(0, 255, 255), Emission=RGB(0, 0, 0), Transparency=0.5, Shine=100)
create_material_24 = CreateMaterial(Diffuse=RGB(222, 222, 222), Specular=RGB(0, 255, 255), Emission=RGB(0, 0, 0), Transparency=0.5, Shine=100)
create_material_25 = CreateMaterial(Diffuse=RGB(199, 199, 199), Specular=RGB(0, 255, 255), Emission=RGB(0, 0, 0), Transparency=0.5, Shine=100)
custom_preview_18 = CustomPreview(Geometry=curve_32, Material=create_material_25)
custom_preview_19 = CustomPreview(Geometry=line_sdl_22, Material=create_material_23)
custom_preview_20 = CustomPreview(Geometry=interpolate_21.Curve, Material=create_material_24)

relative_differences_24 = RelativeDifferences(Values=one_over_x_18)

create_material_26 = CreateMaterial(Diffuse=RGB(235, 235, 235), Specular=RGB(0, 255, 255), Emission=RGB(0, 0, 0), Transparency=0.5, Shine=100)
derivatives_4 = Derivatives(Curve=curve_32, Parameter=divide_curve_17.Parameters)  # -> Point, FirstDerivative, SecondDerivative, ThirdDerivative, FourthDerivative, FifthDerivative, SixthDerivative
panel_57 = Panel(relative_differences_24)
number_slider_26 = Slider(42, range=0..256)
quick_graph_28 = QuickGraph(relative_differences_24, SortOrder=0)
multiplication_14 = Multiplication(A=relative_differences_24, B=digit_scroller_9)
line_sdl_23 = LineSDL(Start=evaluate_length_29.Point, Direction=derivatives_4.SecondDerivative, Length=expr("-ABS(X)", multiplication_14))
evaluate_length_30 = EvaluateLength(Curve=line_sdl_23, Length=1, Normalized=True)  # -> Point, Tangent, Parameter
line_sdl_24 = LineSDL(Start=evaluate_length_30.Point, Direction=derivatives_4.ThirdDerivative, Length=expr("-X", multiplication_14))
custom_preview_21 = CustomPreview(Geometry=line_sdl_24, Material=create_material_26)
interpolate_22 = Interpolate(Vertices=evaluate_length_30.Point, Degree=3, Periodic=False, KnotStyle=2)  # -> Curve, Length, Domain
curve_33 = Curve(interpolate_21.Curve)
number_21 = Number(number)
divide_curve_18 = DivideCurve(Curve=curve_33, Count=number_21, Kinks=False)  # -> Points, Tangents, Parameters
curvature_18 = Curvature(Curve=curve_33, Parameter=divide_curve_18.Parameters)  # -> Point, Curvature, Curvature_2
deconstruct_arc_18 = DeconstructArc(Arc=curvature_18.Curvature_2)  # -> BasePlane, Radius, Angle
one_over_x_19 = OneOverX(Value=deconstruct_arc_18.Radius)
line_18 = Line(StartPoint=curvature_18.Point, EndPoint=deconstruct_arc_18.BasePlane)
create_material_27 = CreateMaterial(Diffuse=RGB(224, 224, 224), Specular=RGB(0, 255, 255), Emission=RGB(0, 0, 0), Transparency=0.5, Shine=100)
create_material_28 = CreateMaterial(Diffuse=RGB(242, 242, 242), Specular=RGB(0, 255, 255), Emission=RGB(0, 0, 0), Transparency=0.5, Shine=100)
custom_preview_22 = CustomPreview(Geometry=interpolate_22.Curve, Material=create_material_27)
custom_preview_23 = CustomPreview(Geometry=line_sdl_23, Material=create_material_28)

evaluate_length_31 = EvaluateLength(Curve=line_sdl_24, Length=1, Normalized=True)  # -> Point, Tangent, Parameter
interpolate_23 = Interpolate(Vertices=evaluate_length_31.Point, Degree=3, Periodic=False, KnotStyle=2)  # -> Curve, Length, Domain
nurbs_curve_15 = NurbsCurve(Vertices=evaluate_length_31.Point, Degree=11, Periodic=False)  # -> Curve, Length, Domain
nurbs_curve_16 = NurbsCurve(Vertices=evaluate_length_30.Point, Degree=11, Periodic=False)  # -> Curve, Length, Domain
nurbs_curve_17 = NurbsCurve(Vertices=evaluate_length_29.Point, Degree=11, Periodic=False)  # -> Curve, Length, Domain

yz_plane_3 = YZPlane(Origin=evaluate_length_28.Point)

curve_34 = Curve(curve_25)
mirror_13 = Mirror(Geometry=curve_34, Plane=yz_plane_3)  # -> Geometry, Transform
scale_nu_5 = ScaleNU(Geometry=[curve_34, mirror_13.Geometry], Plane=PlaneXY(0, 0, 0), ScaleX=0.5, ScaleY=expr("-X", 0.5), ScaleZ=1)  # -> Geometry, Transform
move_20 = Move(Geometry=scale_nu_5.Geometry, Motion=Vector(2, -0.5, 0))  # -> Geometry, Transform

curve_35 = Curve(graft([curve_9, move_10.Geometry, move_20.Geometry]))
divide_curve_19 = DivideCurve(Curve=curve_35, Count=number_8, Kinks=False)  # -> Points, Tangents, Parameters
curvature_19 = Curvature(Curve=curve_35, Parameter=divide_curve_19.Parameters)  # -> Point, Curvature, Curvature_2
deconstruct_arc_19 = DeconstructArc(Arc=curvature_19.Curvature_2)  # -> BasePlane, Radius, Angle
line_19 = Line(StartPoint=curvature_19.Point, EndPoint=deconstruct_arc_19.BasePlane)
one_over_x_20 = OneOverX(Value=deconstruct_arc_19.Radius)
panel_58 = Panel(one_over_x_20)
quick_graph_29 = QuickGraph(one_over_x_20, SortOrder=0)
multiplication_15 = Multiplication(A=one_over_x_20, B=Slider(0.015666, range=0..0.5))
line_sdl_25 = LineSDL(Start=curvature_19.Point, Direction=line_19, Length=expr("-ABS(X)", multiplication_15))
evaluate_length_32 = EvaluateLength(Curve=line_sdl_25, Length=1, Normalized=True)  # -> Point, Tangent, Parameter
interpolate_24 = Interpolate(Vertices=evaluate_length_32.Point, Degree=3, Periodic=False, KnotStyle=2)  # -> Curve, Length, Domain
custom_preview_24 = CustomPreview(Geometry=line_sdl_25, Material=create_material_6)
custom_preview_25 = CustomPreview(Geometry=interpolate_24.Curve, Material=create_material_7)
custom_preview_26 = CustomPreview(Geometry=[curve_35, curve_8], Material=create_material_8)

relative_differences_25 = RelativeDifferences(Values=one_over_x_20)

derivatives_5 = Derivatives(Curve=curve_35, Parameter=divide_curve_19.Parameters)  # -> Point, FirstDerivative, SecondDerivative, ThirdDerivative, FourthDerivative, FifthDerivative, SixthDerivative
panel_59 = Panel(relative_differences_25)
quick_graph_30 = QuickGraph(relative_differences_25, SortOrder=0)
multiplication_16 = Multiplication(A=relative_differences_25, B=digit_scroller_3)
line_sdl_26 = LineSDL(Start=evaluate_length_32.Point, Direction=line_19, Length=expr("-ABS(X)", multiplication_16))
evaluate_length_33 = EvaluateLength(Curve=line_sdl_26, Length=1, Normalized=True)  # -> Point, Tangent, Parameter
line_sdl_27 = LineSDL(Start=evaluate_length_33.Point, Direction=derivatives_5.ThirdDerivative, Length=expr("-X", multiplication_16))
custom_preview_27 = CustomPreview(Geometry=line_sdl_27, Material=create_material_3)
interpolate_25 = Interpolate(Vertices=evaluate_length_33.Point, Degree=3, Periodic=False, KnotStyle=2)  # -> Curve, Length, Domain
curve_36 = Curve(interpolate_24.Curve)
divide_curve_20 = DivideCurve(Curve=curve_36, Count=number_7, Kinks=False)  # -> Points, Tangents, Parameters
curvature_20 = Curvature(Curve=curve_36, Parameter=divide_curve_20.Parameters)  # -> Point, Curvature, Curvature_2
deconstruct_arc_20 = DeconstructArc(Arc=curvature_20.Curvature_2)  # -> BasePlane, Radius, Angle
one_over_x_21 = OneOverX(Value=deconstruct_arc_20.Radius)
line_20 = Line(StartPoint=curvature_20.Point, EndPoint=deconstruct_arc_20.BasePlane)
custom_preview_28 = CustomPreview(Geometry=interpolate_25.Curve, Material=create_material_4)
custom_preview_29 = CustomPreview(Geometry=line_sdl_26, Material=create_material_5)

nurbs_curve_18 = NurbsCurve(Vertices=evaluate_length_33.Point, Degree=11, Periodic=False)  # -> Curve, Length, Domain
nurbs_curve_19 = NurbsCurve(Vertices=evaluate_length_32.Point, Degree=11, Periodic=False)  # -> Curve, Length, Domain

polyline_7 = PolyLine(Vertices=curvature_19.Point, Closed=False)
explode_7 = Explode(Curve=polyline_7, Recursive=True)  # -> Segments, Vertices
curve_37 = Curve(flatten(explode_7.Segments))
length_7 = Length(Curve=curve_37)
sort_list_7 = SortList(Keys=length_7, ValuesValuesA=curve_37)  # -> Keys, ValuesValuesA
panel_60 = Panel(sort_list_7.Keys)
list_item_17 = ListItem(List=sort_list_7.Keys, Index=0, Wrap=False)

dot_display_3 = DotDisplay(Point=evaluate_length_33.Point, Colour=RGB(194, 194, 194), Size=expr("X/2", list_item_17))
merge_5 = Merge(Data1=evaluate_length_30.Point)

polyline_8 = PolyLine(Vertices=curvature_17.Point, Closed=False)
explode_8 = Explode(Curve=polyline_8, Recursive=True)  # -> Segments, Vertices
curve_38 = Curve(flatten(explode_8.Segments))
length_8 = Length(Curve=curve_38)
sort_list_8 = SortList(Keys=length_8, ValuesValuesA=curve_38)  # -> Keys, ValuesValuesA
panel_61 = Panel(sort_list_8.Keys)
list_item_18 = ListItem(List=sort_list_8.Keys, Index=0, Wrap=False)

dot_display_4 = DotDisplay(Point=merge_5, Colour=RGB(194, 194, 194), Size=expr("X/2", list_item_18))

merge_6 = Merge(Data1=line_sdl_10, Data2=line_sdl_19, Data3=line_sdl_27)
bounding_box_12 = BoundingBox(Content=flatten(merge_6), Plane=PlaneXY(0, 0, 0), UnionBox=True)  # -> Box, Box_2

line_sdl_28 = LineSDL(Start=Point(0, 0, 0), Direction=Vector(1, 0, 0), Length=1)
divide_curve_21 = DivideCurve(Curve=line_sdl_28, Count=number_20, Kinks=False)  # -> Points, Tangents, Parameters
line_sdl_29 = LineSDL(Start=divide_curve_21.Points, Direction=Vector(0, 1, 0), Length=1)
curve_curve = CurveCurve(CurveA=scale_4.Geometry, CurveB=line_sdl_29)  # -> flatten(Points), ParamsA, ParamsB
deconstruct_2 = Deconstruct(Point=curve_curve.Points)  # -> XComponent, YComponent, ZComponent
panel_62 = Panel(deconstruct_2.YComponent)
file_path = FilePath("C:\TXT.TXT")
txtwriter = VBScript(filePath=file_path, data=panel_62, activate=Button())  # -> out, A; inputs data: list
# ---------- txtwriter: VB ----------
    If activate Then

      Dim i As Integer
      Dim aryText(4) As String

      aryText(0) = "Mary WriteLine"
      aryText(1) = "Had"
      aryText(2) = "Another"
      aryText(3) = "Little"
      aryText(4) = "One"

      ' the data is appended to the file. If file doesnt exist, a new file is created
      Dim objWriter As New System.IO.StreamWriter(filePath, append)

      For i = 0 To data.Count - 1
        objWriter.WriteLine(data(i))
      Next

      objWriter.Close()

    End If

    If clearFile Then
      Dim objWriter As New System.IO.StreamWriter(filePath, False)
      objWriter.Close()
    End If
# ---------- end txtwriter ----------

panel_63 = Panel(one_over_x_18)
divide_curve_22 = DivideCurve(Curve=line_sdl, Count=number_20, Kinks=False)  # -> Points, Tangents, Parameters
line_sdl_30 = LineSDL(Start=divide_curve_22.Points, Direction=Vector(0, 1, 0), Length=panel_63)

panel_64 = Panel(relative_differences_24)
line_sdl_31 = LineSDL(Start=Point(0, 0, 0), Direction=Vector(1, 0, 0), Length=1)
divide_curve_23 = DivideCurve(Curve=line_sdl_31, Count=number_20, Kinks=False)  # -> Points, Tangents, Parameters
line_sdl_32 = LineSDL(Start=divide_curve_23.Points, Direction=Vector(0, 1, 0), Length=panel_64)
evaluate_length_34 = EvaluateLength(Curve=line_sdl_32, Length=1, Normalized=True)  # -> Point, Tangent, Parameter
interpolate_26 = Interpolate(Vertices=evaluate_length_34.Point, Degree=3, Periodic=False, KnotStyle=2)  # -> Curve, Length, Domain
divide_curve_24 = DivideCurve(Curve=interpolate_26.Curve, Count=number_20, Kinks=False)  # -> Points, Tangents, Parameters
curvature_21 = Curvature(Curve=interpolate_26.Curve, Parameter=divide_curve_24.Parameters)  # -> Point, Curvature, Curvature_2
deconstruct_arc_21 = DeconstructArc(Arc=curvature_21.Curvature_2)  # -> BasePlane, Radius, Angle
one_over_x_22 = OneOverX(Value=deconstruct_arc_21.Radius)

panel_65 = Panel(relative_differences_24)
line_sdl_33 = LineSDL(Start=Point(0, 0, 0), Direction=Vector(1, 0, 0), Length=1)
divide_curve_25 = DivideCurve(Curve=line_sdl_33, Count=number_20, Kinks=False)  # -> Points, Tangents, Parameters
line_sdl_34 = LineSDL(Start=divide_curve_25.Points, Direction=Vector(0, 1, 0), Length=panel_65)
evaluate_length_35 = EvaluateLength(Curve=line_sdl_34, Length=1, Normalized=True)  # -> Point, Tangent, Parameter
interpolate_27 = Interpolate(Vertices=evaluate_length_35.Point, Degree=3, Periodic=False, KnotStyle=2)  # -> Curve, Length, Domain
divide_curve_26 = DivideCurve(Curve=interpolate_27.Curve, Count=number_20, Kinks=False)  # -> Points, Tangents, Parameters
curvature_22 = Curvature(Curve=interpolate_27.Curve, Parameter=divide_curve_26.Parameters)  # -> Point, Curvature, Curvature_2
deconstruct_arc_22 = DeconstructArc(Arc=curvature_22.Curvature_2)  # -> BasePlane, Radius, Angle
one_over_x_23 = OneOverX(Value=deconstruct_arc_22.Radius)

smooth_curve = SmoothCurve(
    Curve=interpolate_26.Curve,
    Steps=digit_scroller_10,
    StartType=0,
    EndType=0,
    DeviationTolerance=digit_scroller_12,
    AngleTolerance=digit_scroller_11)  # disabled
divide_curve_27 = DivideCurve(Curve=line_sdl_2, Count=number_20, Kinks=False)  # -> Points, Tangents, Parameters
line_sdl_35 = LineSDL(Start=divide_curve_27.Points, Direction=Vector(0, 1, 0), Length=one_over_x_22)
divide_curve_28 = DivideCurve(Curve=smooth_curve, Count=number_20, Kinks=False)  # -> Points, Tangents, Parameters
curvature_23 = Curvature(Curve=smooth_curve, Parameter=divide_curve_28.Parameters)  # -> Point, Curvature, Curvature_2
deconstruct_arc_23 = DeconstructArc(Arc=curvature_23.Curvature_2)  # -> BasePlane, Radius, Angle
one_over_x_24 = OneOverX(Value=deconstruct_arc_23.Radius)
relative_differences_26 = RelativeDifferences(Values=one_over_x_24)
multiplication_17 = Multiplication(A=relative_differences_26, B=digit_scroller_13)
line_sdl_36 = LineSDL(Start=divide_curve_27.Points, Direction=line_sdl_32, Length=expr("ABS(X)", multiplication_17))
smooth_curve_2 = SmoothCurve(
    Curve=interpolate_27.Curve,
    Steps=digit_scroller_14,
    StartType=0,
    EndType=0,
    DeviationTolerance=digit_scroller_15,
    AngleTolerance=digit_scroller_16)  # disabled
divide_curve_29 = DivideCurve(Curve=line_sdl_3, Count=number_20, Kinks=False)  # -> Points, Tangents, Parameters
line_sdl_37 = LineSDL(Start=divide_curve_29.Points, Direction=Vector(0, 1, 0), Length=one_over_x_23)
divide_curve_30 = DivideCurve(Curve=smooth_curve_2, Count=number_20, Kinks=False)  # -> Points, Tangents, Parameters
curvature_24 = Curvature(Curve=smooth_curve_2, Parameter=divide_curve_30.Parameters)  # -> Point, Curvature, Curvature_2
deconstruct_arc_24 = DeconstructArc(Arc=curvature_24.Curvature_2)  # -> BasePlane, Radius, Angle
one_over_x_25 = OneOverX(Value=deconstruct_arc_24.Radius)
relative_differences_27 = RelativeDifferences(Values=one_over_x_25)
multiplication_18 = Multiplication(A=relative_differences_27, B=digit_scroller_17)
line_sdl_38 = LineSDL(Start=divide_curve_29.Points, Direction=line_sdl_34, Length=expr("ABS(X)", multiplication_18))

divide_curve_31 = DivideCurve(Curve=curve, Count=expr("X*2", number_20), Kinks=False)  # -> Points, Tangents, Parameters
curvature_25 = Curvature(Curve=curve, Parameter=divide_curve_31.Parameters)  # -> Point, Curvature, Curvature_2
deconstruct_arc_25 = DeconstructArc(Arc=curvature_25.Curvature_2)  # -> BasePlane, Radius, Angle
line_21 = Line(StartPoint=deconstruct_arc_25.BasePlane, EndPoint=curvature_25.Point)
one_over_x_26 = OneOverX(Value=deconstruct_arc_25.Radius)
bounds_3 = Bounds(Numbers=one_over_x_26)
remap_numbers_3 = RemapNumbers(Value=one_over_x_26, Source=bounds_3, Target=Domain(0, 1))  # -> Mapped, Clipped
division_13 = Division(A=remap_numbers_3.Mapped, B=digit_scroller_18)
line_sdl_39 = LineSDL(Start=curvature_25.Point, Direction=line_21, Length=division_13)
evaluate_length_36 = EvaluateLength(Curve=line_sdl_39, Length=1, Normalized=True)  # -> Point, Tangent, Parameter
interpolate_28 = Interpolate(Vertices=evaluate_length_36.Point, Degree=3, Periodic=False, KnotStyle=2)  # -> Curve, Length, Domain

mirror_14 = Mirror(Geometry=curve, Plane=yz_plane)  # -> Geometry, Transform
join_curves_10 = JoinCurves(Curves=[curve, mirror_14.Geometry], Preserve=False)
scale_5 = Scale(Geometry=join_curves_9, Center=Point(0, 0, 0), Factor=expr("X^-1", deconstruct_box_10.X))  # -> Geometry, Transform

linear_array = LinearArray(Geometry=join_curves_10, Direction=Vector(2, 0, 0), Count=256)  # -> Geometry, Transform
join_curves_11 = JoinCurves(Curves=linear_array.Geometry, Preserve=False)

digit_scroller_31 = DigitScroller(Scroller_Digits=12, Scroller_Prefix="Digit Scroller", Scroller_Radix=9, Scroller_Value=512)
line_sdl_40 = LineSDL(Start=Point(0, 0, 0), Direction=Vector(1, 0, 0), Length=digit_scroller_31)
division_14 = Division(A=number_20, B=0.5)
divide_curve_32 = DivideCurve(Curve=line_sdl_40, Count=division_14, Kinks=False)  # -> Points, Tangents, Parameters
line_sdl_41 = LineSDL(Start=divide_curve_32.Points, Direction=Vector(0, 1, 0), Length=1)
curve_curve_2 = CurveCurve(CurveA=join_curves_11, CurveB=line_sdl_41)  # -> flatten(Points), ParamsA, ParamsB
deconstruct_3 = Deconstruct(Point=curve_curve_2.Points)  # -> XComponent, YComponent, ZComponent

digit_scroller_32 = DigitScroller(Scroller_Digits=12, Scroller_Prefix="Digit Scroller", Scroller_Radix=9, Scroller_Value=256)
line_sdl_42 = LineSDL(Start=Point(0, 0, 0), Direction=Vector(1, 0, 0), Length=digit_scroller_32)
division_15 = Division(A=number_20, B=0.5)
divide_curve_33 = DivideCurve(Curve=line_sdl_42, Count=division_15, Kinks=False)  # -> Points, Tangents, Parameters
line_sdl_43 = LineSDL(Start=divide_curve_33.Points, Direction=Vector(0, 1, 0), Length=1)
curve_curve_3 = CurveCurve(CurveA=join_curves_11, CurveB=line_sdl_43)  # -> flatten(Points), ParamsA, ParamsB
deconstruct_4 = Deconstruct(Point=curve_curve_3.Points)  # -> XComponent, YComponent, ZComponent

digit_scroller_33 = DigitScroller(Scroller_Digits=12, Scroller_Prefix="Digit Scroller", Scroller_Radix=9, Scroller_Value=128)
line_sdl_44 = LineSDL(Start=Point(0, 0, 0), Direction=Vector(1, 0, 0), Length=digit_scroller_33)
division_16 = Division(A=number_20, B=0.5)
divide_curve_34 = DivideCurve(Curve=line_sdl_44, Count=division_16, Kinks=False)  # -> Points, Tangents, Parameters
line_sdl_45 = LineSDL(Start=divide_curve_34.Points, Direction=Vector(0, 1, 0), Length=1)
curve_curve_4 = CurveCurve(CurveA=join_curves_11, CurveB=line_sdl_45)  # -> flatten(Points), ParamsA, ParamsB
deconstruct_5 = Deconstruct(Point=curve_curve_4.Points)  # -> XComponent, YComponent, ZComponent

digit_scroller_34 = DigitScroller(Scroller_Digits=12, Scroller_Prefix="Digit Scroller", Scroller_Radix=9, Scroller_Value=64)
line_sdl_46 = LineSDL(Start=Point(0, 0, 0), Direction=Vector(1, 0, 0), Length=digit_scroller_34)
division_17 = Division(A=number_20, B=0.5)
divide_curve_35 = DivideCurve(Curve=line_sdl_46, Count=division_17, Kinks=False)  # -> Points, Tangents, Parameters
line_sdl_47 = LineSDL(Start=divide_curve_35.Points, Direction=Vector(0, 1, 0), Length=1)
curve_curve_5 = CurveCurve(CurveA=join_curves_11, CurveB=line_sdl_47)  # -> flatten(Points), ParamsA, ParamsB
deconstruct_6 = Deconstruct(Point=curve_curve_5.Points)  # -> XComponent, YComponent, ZComponent

digit_scroller_35 = DigitScroller(Scroller_Digits=12, Scroller_Prefix="Digit Scroller", Scroller_Radix=9, Scroller_Value=32)
line_sdl_48 = LineSDL(Start=Point(0, 0, 0), Direction=Vector(1, 0, 0), Length=digit_scroller_35)
division_18 = Division(A=number_20, B=0.5)
divide_curve_36 = DivideCurve(Curve=line_sdl_48, Count=division_18, Kinks=False)  # -> Points, Tangents, Parameters
line_sdl_49 = LineSDL(Start=divide_curve_36.Points, Direction=Vector(0, 1, 0), Length=1)
curve_curve_6 = CurveCurve(CurveA=join_curves_11, CurveB=line_sdl_49)  # -> flatten(Points), ParamsA, ParamsB
deconstruct_7 = Deconstruct(Point=curve_curve_6.Points)  # -> XComponent, YComponent, ZComponent

digit_scroller_36 = DigitScroller(Scroller_Digits=12, Scroller_Prefix="Digit Scroller", Scroller_Radix=9, Scroller_Value=16)
line_sdl_50 = LineSDL(Start=Point(0, 0, 0), Direction=Vector(1, 0, 0), Length=digit_scroller_36)
division_19 = Division(A=number_20, B=0.5)
divide_curve_37 = DivideCurve(Curve=line_sdl_50, Count=division_19, Kinks=False)  # -> Points, Tangents, Parameters
line_sdl_51 = LineSDL(Start=divide_curve_37.Points, Direction=Vector(0, 1, 0), Length=1)
curve_curve_7 = CurveCurve(CurveA=join_curves_11, CurveB=line_sdl_51)  # -> flatten(Points), ParamsA, ParamsB
deconstruct_8 = Deconstruct(Point=curve_curve_7.Points)  # -> XComponent, YComponent, ZComponent

digit_scroller_37 = DigitScroller(Scroller_Digits=12, Scroller_Prefix="Digit Scroller", Scroller_Radix=9, Scroller_Value=8)
line_sdl_52 = LineSDL(Start=Point(0, 0, 0), Direction=Vector(1, 0, 0), Length=digit_scroller_37)
division_20 = Division(A=number_20, B=0.5)
divide_curve_38 = DivideCurve(Curve=line_sdl_52, Count=division_20, Kinks=False)  # -> Points, Tangents, Parameters
line_sdl_53 = LineSDL(Start=divide_curve_38.Points, Direction=Vector(0, 1, 0), Length=1)
curve_curve_8 = CurveCurve(CurveA=join_curves_11, CurveB=line_sdl_53)  # -> flatten(Points), ParamsA, ParamsB
deconstruct_9 = Deconstruct(Point=curve_curve_8.Points)  # -> XComponent, YComponent, ZComponent

digit_scroller_38 = DigitScroller(Scroller_Digits=12, Scroller_Prefix="Digit Scroller", Scroller_Radix=9, Scroller_Value=4)
line_sdl_54 = LineSDL(Start=Point(0, 0, 0), Direction=Vector(1, 0, 0), Length=digit_scroller_38)
division_21 = Division(A=number_20, B=0.5)
divide_curve_39 = DivideCurve(Curve=line_sdl_54, Count=division_21, Kinks=False)  # -> Points, Tangents, Parameters
line_sdl_55 = LineSDL(Start=divide_curve_39.Points, Direction=Vector(0, 1, 0), Length=1)
curve_curve_9 = CurveCurve(CurveA=join_curves_11, CurveB=line_sdl_55)  # -> flatten(Points), ParamsA, ParamsB
deconstruct_10 = Deconstruct(Point=curve_curve_9.Points)  # -> XComponent, YComponent, ZComponent

bounds_4 = Bounds(Numbers=deconstruct_3.YComponent)
remap_numbers_4 = RemapNumbers(Value=deconstruct_3.YComponent, Source=bounds_4, Target=Domain(0, 1))  # -> Mapped, Clipped
division_22 = Division(A=remap_numbers_4.Mapped, B=digit_scroller_18)

bounds_5 = Bounds(Numbers=deconstruct_4.YComponent)
remap_numbers_5 = RemapNumbers(Value=deconstruct_4.YComponent, Source=bounds_5, Target=Domain(0, 1))  # -> Mapped, Clipped
division_23 = Division(A=remap_numbers_5.Mapped, B=digit_scroller_18)

bounds_6 = Bounds(Numbers=deconstruct_5.YComponent)
remap_numbers_6 = RemapNumbers(Value=deconstruct_5.YComponent, Source=bounds_6, Target=Domain(0, 1))  # -> Mapped, Clipped
division_24 = Division(A=remap_numbers_6.Mapped, B=digit_scroller_18)

bounds_7 = Bounds(Numbers=deconstruct_6.YComponent)
remap_numbers_7 = RemapNumbers(Value=deconstruct_6.YComponent, Source=bounds_7, Target=Domain(0, 1))  # -> Mapped, Clipped
division_25 = Division(A=remap_numbers_7.Mapped, B=digit_scroller_18)

bounds_8 = Bounds(Numbers=deconstruct_7.YComponent)
remap_numbers_8 = RemapNumbers(Value=deconstruct_7.YComponent, Source=bounds_8, Target=Domain(0, 1))  # -> Mapped, Clipped
division_26 = Division(A=remap_numbers_8.Mapped, B=digit_scroller_18)

bounds_9 = Bounds(Numbers=deconstruct_8.YComponent)
remap_numbers_9 = RemapNumbers(Value=deconstruct_8.YComponent, Source=bounds_9, Target=Domain(0, 1))  # -> Mapped, Clipped
division_27 = Division(A=remap_numbers_9.Mapped, B=digit_scroller_18)

bounds_10 = Bounds(Numbers=deconstruct_9.YComponent)
remap_numbers_10 = RemapNumbers(Value=deconstruct_9.YComponent, Source=bounds_10, Target=Domain(0, 1))  # -> Mapped, Clipped
division_28 = Division(A=remap_numbers_10.Mapped, B=digit_scroller_18)

bounds_11 = Bounds(Numbers=deconstruct_10.YComponent)
remap_numbers_11 = RemapNumbers(Value=deconstruct_10.YComponent, Source=bounds_11, Target=Domain(0, 1))  # -> Mapped, Clipped
division_29 = Division(A=remap_numbers_11.Mapped, B=digit_scroller_18)

divide_curve_40 = DivideCurve(Curve=interpolate_28.Curve, Count=number_20, Kinks=False)  # -> Points, Tangents, Parameters
curvature_26 = Curvature(Curve=interpolate_28.Curve, Parameter=divide_curve_40.Parameters)  # -> Point, Curvature, Curvature_2
line_sdl_56 = LineSDL(Start=evaluate_length_36.Point, Direction=line_21, Length=expr("X/2", division_29))
evaluate_length_37 = EvaluateLength(Curve=line_sdl_56, Length=1, Normalized=True)  # -> Point, Tangent, Parameter
interpolate_29 = Interpolate(Vertices=evaluate_length_37.Point, Degree=3, Periodic=False, KnotStyle=2)  # -> Curve, Length, Domain
deconstruct_arc_26 = DeconstructArc(Arc=curvature_26.Curvature_2)  # -> BasePlane, Radius, Angle

line_sdl_57 = LineSDL(Start=evaluate_length_37.Point, Direction=line_21, Length=expr("X/4", division_28))
evaluate_length_38 = EvaluateLength(Curve=line_sdl_57, Length=1, Normalized=True)  # -> Point, Tangent, Parameter
interpolate_30 = Interpolate(Vertices=evaluate_length_38.Point, Degree=3, Periodic=False, KnotStyle=2)  # -> Curve, Length, Domain

divide_curve_41 = DivideCurve(Curve=interpolate_30.Curve, Count=number_20, Kinks=False)  # -> Points, Tangents, Parameters
curvature_27 = Curvature(Curve=interpolate_28.Curve, Parameter=divide_curve_41.Parameters)  # -> Point, Curvature, Curvature_2
line_sdl_58 = LineSDL(Start=evaluate_length_38.Point, Direction=line_21, Length=expr("X/8", division_27))
evaluate_length_39 = EvaluateLength(Curve=line_sdl_58, Length=1, Normalized=True)  # -> Point, Tangent, Parameter
interpolate_31 = Interpolate(Vertices=evaluate_length_39.Point, Degree=3, Periodic=False, KnotStyle=2)  # -> Curve, Length, Domain
deconstruct_arc_27 = DeconstructArc(Arc=curvature_27.Curvature_2)  # -> BasePlane, Radius, Angle

divide_curve_42 = DivideCurve(Curve=interpolate_31.Curve, Count=number_20, Kinks=False)  # -> Points, Tangents, Parameters
curvature_28 = Curvature(Curve=interpolate_28.Curve, Parameter=divide_curve_42.Parameters)  # -> Point, Curvature, Curvature_2
line_sdl_59 = LineSDL(Start=evaluate_length_39.Point, Direction=line_21, Length=expr("X/16", division_26))
evaluate_length_40 = EvaluateLength(Curve=line_sdl_59, Length=1, Normalized=True)  # -> Point, Tangent, Parameter
interpolate_32 = Interpolate(Vertices=evaluate_length_40.Point, Degree=3, Periodic=False, KnotStyle=2)  # -> Curve, Length, Domain
deconstruct_arc_28 = DeconstructArc(Arc=curvature_28.Curvature_2)  # -> BasePlane, Radius, Angle

divide_curve_43 = DivideCurve(Curve=interpolate_31.Curve, Count=number_20, Kinks=False)  # -> Points, Tangents, Parameters
curvature_29 = Curvature(Curve=interpolate_28.Curve, Parameter=divide_curve_43.Parameters)  # -> Point, Curvature, Curvature_2
line_sdl_60 = LineSDL(Start=evaluate_length_40.Point, Direction=line_21, Length=expr("X/32", division_25))
evaluate_length_41 = EvaluateLength(Curve=line_sdl_60, Length=1, Normalized=True)  # -> Point, Tangent, Parameter
interpolate_33 = Interpolate(Vertices=evaluate_length_41.Point, Degree=3, Periodic=False, KnotStyle=2)  # -> Curve, Length, Domain
deconstruct_arc_29 = DeconstructArc(Arc=curvature_29.Curvature_2)  # -> BasePlane, Radius, Angle

divide_curve_44 = DivideCurve(Curve=interpolate_31.Curve, Count=number_20, Kinks=False)  # -> Points, Tangents, Parameters
curvature_30 = Curvature(Curve=interpolate_28.Curve, Parameter=divide_curve_44.Parameters)  # -> Point, Curvature, Curvature_2
line_sdl_61 = LineSDL(Start=evaluate_length_41.Point, Direction=line_21, Length=expr("X/32", division_24))
evaluate_length_42 = EvaluateLength(Curve=line_sdl_61, Length=1, Normalized=True)  # -> Point, Tangent, Parameter
interpolate_34 = Interpolate(Vertices=evaluate_length_42.Point, Degree=3, Periodic=False, KnotStyle=2)  # -> Curve, Length, Domain
deconstruct_arc_30 = DeconstructArc(Arc=curvature_30.Curvature_2)  # -> BasePlane, Radius, Angle

divide_curve_45 = DivideCurve(Curve=interpolate_31.Curve, Count=number_20, Kinks=False)  # -> Points, Tangents, Parameters
curvature_31 = Curvature(Curve=interpolate_28.Curve, Parameter=divide_curve_45.Parameters)  # -> Point, Curvature, Curvature_2
line_sdl_62 = LineSDL(Start=evaluate_length_42.Point, Direction=line_21, Length=expr("X/64", division_23))
evaluate_length_43 = EvaluateLength(Curve=line_sdl_62, Length=1, Normalized=True)  # -> Point, Tangent, Parameter
interpolate_35 = Interpolate(Vertices=evaluate_length_43.Point, Degree=3, Periodic=False, KnotStyle=2)  # -> Curve, Length, Domain
deconstruct_arc_31 = DeconstructArc(Arc=curvature_31.Curvature_2)  # -> BasePlane, Radius, Angle

divide_curve_46 = DivideCurve(Curve=interpolate_31.Curve, Count=number_20, Kinks=False)  # -> Points, Tangents, Parameters
curvature_32 = Curvature(Curve=interpolate_28.Curve, Parameter=divide_curve_46.Parameters)  # -> Point, Curvature, Curvature_2
line_sdl_63 = LineSDL(Start=evaluate_length_43.Point, Direction=line_21, Length=expr("X/128", division_22))
evaluate_length_44 = EvaluateLength(Curve=line_sdl_63, Length=1, Normalized=True)  # -> Point, Tangent, Parameter
interpolate_36 = Interpolate(Vertices=evaluate_length_44.Point, Degree=3, Periodic=False, KnotStyle=2)  # -> Curve, Length, Domain
deconstruct_arc_32 = DeconstructArc(Arc=curvature_32.Curvature_2)  # -> BasePlane, Radius, Angle

mirror_15 = Mirror(Geometry=interpolate_36.Curve, Plane=yz_plane)  # -> Geometry, Transform
mirror_16 = Mirror(Geometry=line_sdl_63, Plane=yz_plane)  # -> Geometry, Transform
mirror_17 = Mirror(Geometry=interpolate_35.Curve, Plane=yz_plane)  # -> Geometry, Transform
mirror_18 = Mirror(Geometry=line_sdl_62, Plane=yz_plane)  # -> Geometry, Transform
mirror_19 = Mirror(Geometry=interpolate_34.Curve, Plane=yz_plane)  # -> Geometry, Transform
mirror_20 = Mirror(Geometry=line_sdl_61, Plane=yz_plane)  # -> Geometry, Transform
mirror_21 = Mirror(Geometry=interpolate_33.Curve, Plane=yz_plane)  # -> Geometry, Transform
mirror_22 = Mirror(Geometry=line_sdl_60, Plane=yz_plane)  # -> Geometry, Transform
mirror_23 = Mirror(Geometry=interpolate_32.Curve, Plane=yz_plane)  # -> Geometry, Transform
mirror_24 = Mirror(Geometry=line_sdl_59, Plane=yz_plane)  # -> Geometry, Transform
mirror_25 = Mirror(Geometry=interpolate_31.Curve, Plane=yz_plane)  # -> Geometry, Transform
mirror_26 = Mirror(Geometry=line_sdl_58, Plane=yz_plane)  # -> Geometry, Transform
mirror_27 = Mirror(Geometry=interpolate_30.Curve, Plane=yz_plane)  # -> Geometry, Transform
mirror_28 = Mirror(Geometry=line_sdl_57, Plane=yz_plane)  # -> Geometry, Transform
mirror_29 = Mirror(Geometry=interpolate_29.Curve, Plane=yz_plane)  # -> Geometry, Transform
mirror_30 = Mirror(Geometry=line_sdl_56, Plane=yz_plane)  # -> Geometry, Transform
mirror_31 = Mirror(Geometry=interpolate_28.Curve, Plane=yz_plane)  # -> Geometry, Transform
mirror_32 = Mirror(Geometry=line_sdl_39, Plane=yz_plane)  # -> Geometry, Transform

colour_picker_2 = ColourPicker(PickedColour=RGB(240, 240, 240))
create_material_29 = CreateMaterial(Diffuse=colour_picker_2, Specular=RGB(255, 255, 255), Emission=RGB(0, 0, 0), Transparency=0, Shine=0)
custom_preview_30 = CustomPreview(Geometry=line_sdl_56, Material=create_material_29)

colour_picker_3 = ColourPicker(PickedColour=RGB(247, 247, 247))
create_material_30 = CreateMaterial(Diffuse=colour_picker_3, Specular=RGB(255, 255, 255), Emission=RGB(0, 0, 0), Transparency=0, Shine=0)
custom_preview_31 = CustomPreview(Geometry=line_sdl_39, Material=create_material_30)

colour_picker_4 = ColourPicker(PickedColour=RGB(214, 214, 214))
create_material_31 = CreateMaterial(Diffuse=colour_picker_4, Specular=RGB(255, 255, 255), Emission=RGB(0, 0, 0), Transparency=0, Shine=0)
custom_preview_32 = CustomPreview(Geometry=interpolate_29.Curve, Material=create_material_31)

colour_picker_5 = ColourPicker(PickedColour=RGB(222, 222, 222))
create_material_32 = CreateMaterial(Diffuse=colour_picker_5, Specular=RGB(255, 255, 255), Emission=RGB(0, 0, 0), Transparency=0, Shine=0)
custom_preview_33 = CustomPreview(Geometry=interpolate_28.Curve, Material=create_material_32)

colour_picker_6 = ColourPicker(PickedColour=RGB(232, 232, 232))
create_material_33 = CreateMaterial(Diffuse=colour_picker_6, Specular=RGB(255, 255, 255), Emission=RGB(0, 0, 0), Transparency=0, Shine=0)
custom_preview_34 = CustomPreview(Geometry=line_sdl_57, Material=create_material_33)

colour_picker_7 = ColourPicker(PickedColour=RGB(207, 207, 207))
create_material_34 = CreateMaterial(Diffuse=colour_picker_7, Specular=RGB(255, 255, 255), Emission=RGB(0, 0, 0), Transparency=0, Shine=0)
custom_preview_35 = CustomPreview(Geometry=interpolate_30.Curve, Material=create_material_34)

colour_picker_8 = ColourPicker(PickedColour=RGB(224, 224, 224))
create_material_35 = CreateMaterial(Diffuse=colour_picker_8, Specular=RGB(255, 255, 255), Emission=RGB(0, 0, 0), Transparency=0, Shine=0)
custom_preview_36 = CustomPreview(Geometry=line_sdl_58, Material=create_material_35)

colour_picker_9 = ColourPicker(PickedColour=RGB(217, 217, 217))
create_material_36 = CreateMaterial(Diffuse=colour_picker_9, Specular=RGB(255, 255, 255), Emission=RGB(0, 0, 0), Transparency=0, Shine=0)
custom_preview_37 = CustomPreview(Geometry=line_sdl_59, Material=create_material_36)

colour_picker_10 = ColourPicker(PickedColour=RGB(199, 199, 199))
create_material_37 = CreateMaterial(Diffuse=colour_picker_10, Specular=RGB(255, 255, 255), Emission=RGB(0, 0, 0), Transparency=0, Shine=0)
custom_preview_38 = CustomPreview(Geometry=interpolate_31.Curve, Material=create_material_37)

colour_picker_11 = ColourPicker(PickedColour=RGB(209, 209, 209))
create_material_38 = CreateMaterial(Diffuse=colour_picker_11, Specular=RGB(255, 255, 255), Emission=RGB(0, 0, 0), Transparency=0, Shine=0)
custom_preview_39 = CustomPreview(Geometry=line_sdl_60, Material=create_material_38)

colour_picker_12 = ColourPicker(PickedColour=RGB(191, 191, 191))
create_material_39 = CreateMaterial(Diffuse=colour_picker_12, Specular=RGB(255, 255, 255), Emission=RGB(0, 0, 0), Transparency=0, Shine=0)
custom_preview_40 = CustomPreview(Geometry=interpolate_32.Curve, Material=create_material_39)

colour_picker_13 = ColourPicker(PickedColour=RGB(184, 184, 184))
create_material_40 = CreateMaterial(Diffuse=colour_picker_13, Specular=RGB(255, 255, 255), Emission=RGB(0, 0, 0), Transparency=0, Shine=0)
custom_preview_41 = CustomPreview(Geometry=interpolate_33.Curve, Material=create_material_40)

colour_picker_14 = ColourPicker(PickedColour=RGB(201, 201, 201))
create_material_41 = CreateMaterial(Diffuse=colour_picker_14, Specular=RGB(255, 255, 255), Emission=RGB(0, 0, 0), Transparency=0, Shine=0)
custom_preview_42 = CustomPreview(Geometry=line_sdl_61, Material=create_material_41)

colour_picker_15 = ColourPicker(PickedColour=RGB(176, 176, 176))
create_material_42 = CreateMaterial(Diffuse=colour_picker_15, Specular=RGB(255, 255, 255), Emission=RGB(0, 0, 0), Transparency=0, Shine=0)
custom_preview_43 = CustomPreview(Geometry=interpolate_34.Curve, Material=create_material_42)

colour_picker_16 = ColourPicker(PickedColour=RGB(194, 194, 194))
create_material_43 = CreateMaterial(Diffuse=colour_picker_16, Specular=RGB(255, 255, 255), Emission=RGB(0, 0, 0), Transparency=0, Shine=0)
custom_preview_44 = CustomPreview(Geometry=line_sdl_62, Material=create_material_43)

colour_picker_17 = ColourPicker(PickedColour=RGB(168, 168, 168))
create_material_44 = CreateMaterial(Diffuse=colour_picker_17, Specular=RGB(255, 255, 255), Emission=RGB(0, 0, 0), Transparency=0, Shine=0)
custom_preview_45 = CustomPreview(Geometry=interpolate_35.Curve, Material=create_material_44)

colour_picker_18 = ColourPicker(PickedColour=RGB(161, 161, 161))
create_material_45 = CreateMaterial(Diffuse=colour_picker_18, Specular=RGB(255, 255, 255), Emission=RGB(0, 0, 0), Transparency=0, Shine=0)
custom_preview_46 = CustomPreview(Geometry=interpolate_36.Curve, Material=create_material_45)

colour_picker_19 = ColourPicker(PickedColour=RGB(186, 186, 186))
create_material_46 = CreateMaterial(Diffuse=colour_picker_19, Specular=RGB(255, 255, 255), Emission=RGB(0, 0, 0), Transparency=0, Shine=0)
custom_preview_47 = CustomPreview(Geometry=line_sdl_63, Material=create_material_46)

panel_68 = Panel("""16                
32                
64                
128              
256              0.0019129629683""")
division_30 = Division(A=0.4964279019, B=0.122908661)
curve_39 = Curve(scale_4.Geometry)
evaluate_length_45 = EvaluateLength(Curve=curve_31, Length=0, Normalized=True)  # -> Point, Tangent, Parameter
yz_plane_4 = YZPlane(Origin=evaluate_length_45.Point)
vector_2pt_8 = Vector2Pt(PointA=Point(0, 0, 0), PointB=evaluate_length_45.Point, Unitize=False)  # -> Vector, Length
create_material_47 = CreateMaterial(Diffuse=RGB(255, 105, 180), Specular=RGB(255, 255, 255), Emission=RGB(0, 0, 0), Transparency=0, Shine=0)

digit_scroller_39 = DigitScroller(Scroller_Digits=12, Scroller_Prefix="Digit Scroller", Scroller_Radix=1, Scroller_Value=0.00191296296)
radians_5 = Radians(Degrees="0.0019129629683")
series_9 = Series(Start=0, Step=radians_5, Count=number_slider_6)

curve_graph_mapper_4 = CurveGraphMapper(Curves=curve_39, Rectangle=rectangle.Rectangle, Values=series_9, Flip=False, Snap=False, TextSize=1)  # -> Mapped, GraphCurves, GraphPoints, ValueLines, ValuePoints, MappedLines, MappedPoints, Boundary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

turtle_5 = DotNETVBScriptLEGACY(Forward=duplicate_data, Left=curve_graph_mapper_4.Mapped)  # -> Output, Points; inputs Forward: list, Left: list; disabled; same code as turtle
point_9 = Point(turtle_5.Points)
interpolate_37 = Interpolate(Vertices=turtle_5.Points, Degree=3, Periodic=False, KnotStyle=0)  # -> Curve, Length, Domain

evaluate_length_46 = EvaluateLength(Curve=interpolate_37.Curve, Length=1, Normalized=True)  # -> Point, Tangent, Parameter
line_sdl_64 = LineSDL(Start=evaluate_length_46.Point, Direction=evaluate_length_46.Tangent, Length=1)
mirror_33 = Mirror(Geometry=interpolate_37.Curve, Plane=line_sdl_64)  # -> Geometry, Transform
join_curves_12 = JoinCurves(Curves=[interpolate_37.Curve, mirror_33.Geometry], Preserve=False)
end_points_5 = EndPoints(Curve=join_curves_12)  # -> Start, End
line_22 = Line(StartPoint=end_points_5.Start, EndPoint=end_points_5.End)
angle_10 = Angle(VectorA=Vector(1.4375, 0, 0), VectorB=line_22)  # -> Angle, Reflex
rotate_11 = Rotate(Geometry=join_curves_12, Angle=expr("-X", angle_10.Angle), Plane=evaluate_length_46.Point)  # -> Geometry, Transform
vector_2pt_9 = Vector2Pt(PointA=evaluate_length_46.Point, PointB=Point(0, 0, 0), Unitize=False)  # -> Vector, Length
move_21 = Move(Geometry=rotate_11.Geometry, Motion=vector_2pt_9.Vector)  # -> Geometry, Transform
curve_domain_5 = CurveDomain(Curve=move_21.Geometry)  # -> Curve, Domain
deconstruct_domain_20 = DeconstructDomain(Domain=curve_domain_5.Domain)  # -> Start, End
construct_domain_6 = ConstructDomain(DomainStart=expr("X/2", deconstruct_domain_20.End), DomainEnd=deconstruct_domain_20.End)
sub_curve_5 = SubCurve(BaseCurve=curve_domain_5.Curve, Domain=construct_domain_6)
evaluate_length_47 = EvaluateLength(Curve=sub_curve_5, Length=1, Normalized=True)  # -> Point, Tangent, Parameter
rotate_12 = Rotate(Geometry=sub_curve_5, Angle=3.141592654, Plane=evaluate_length_47.Point)  # -> Geometry, Transform
join_curves_13 = JoinCurves(Curves=[sub_curve_5, rotate_12.Geometry], Preserve=False)
bounding_box_13 = BoundingBox(Content=join_curves_13, Plane=PlaneXY(0, 0, 0), UnionBox=True)  # -> Box, Box_2
deconstruct_box_11 = DeconstructBox(Box=bounding_box_13.Box)  # -> Plane, X, Y, Z
scale_6 = Scale(Geometry=join_curves_13, Center=Point(0, 0, 0), Factor=expr("X^-1", deconstruct_box_11.X))  # -> Geometry, Transform
mirror_34 = Mirror(Geometry=scale_6.Geometry, Plane=yz_plane)  # -> Geometry, Transform
move_22 = Move(Geometry=scale_6.Geometry, Motion=vector_2pt_8.Vector)  # -> Geometry, Transform
curve_40 = Curve(move_22.Geometry)
deconstruct_domain_21 = DeconstructDomain(Domain=deconstruct_box_11.X)  # -> Start, End
deconstruct_domain_22 = DeconstructDomain(Domain=deconstruct_box_11.Y)  # -> Start, End
custom_preview_48 = CustomPreview(Geometry=curve_40, Material=create_material_47)
division_31 = Division(A=deconstruct_domain_21.End, B=deconstruct_domain_22.End)
panel_72 = Panel(division_31)

number_slider_27 = Slider(40, range=0..256)
curve_41 = Curve(curve_40)  # disabled
number_22 = Number(number)
divide_curve_47 = DivideCurve(Curve=curve_41, Count=number_22, Kinks=False)  # -> Points, Tangents, Parameters
curvature_33 = Curvature(Curve=curve_41, Parameter=divide_curve_47.Parameters)  # -> Point, Curvature, Curvature_2
deconstruct_arc_33 = DeconstructArc(Arc=curvature_33.Curvature_2)  # -> BasePlane, Radius, Angle
line_23 = Line(StartPoint=curvature_33.Point, EndPoint=deconstruct_arc_33.BasePlane)
one_over_x_27 = OneOverX(Value=deconstruct_arc_33.Radius)
panel_73 = Panel(one_over_x_27)
quick_graph_31 = QuickGraph(one_over_x_27, SortOrder=0)
multiplication_19 = Multiplication(A=one_over_x_27, B=Slider(0.088888, range=0..0.5))
line_sdl_65 = LineSDL(Start=curvature_33.Point, Direction=line_23, Length=expr("-ABS(X)", multiplication_19))
evaluate_length_48 = EvaluateLength(Curve=line_sdl_65, Length=1, Normalized=True)  # -> Point, Tangent, Parameter
interpolate_38 = Interpolate(Vertices=evaluate_length_48.Point, Degree=3, Periodic=False, KnotStyle=2)  # -> Curve, Length, Domain
create_material_48 = CreateMaterial(Diffuse=RGB(232, 232, 232), Specular=RGB(0, 255, 255), Emission=RGB(0, 0, 0), Transparency=0.5, Shine=100)
create_material_49 = CreateMaterial(Diffuse=RGB(222, 222, 222), Specular=RGB(0, 255, 255), Emission=RGB(0, 0, 0), Transparency=0.5, Shine=100)
create_material_50 = CreateMaterial(Diffuse=RGB(199, 199, 199), Specular=RGB(0, 255, 255), Emission=RGB(0, 0, 0), Transparency=0.5, Shine=100)
custom_preview_49 = CustomPreview(Geometry=curve_41, Material=create_material_50)
custom_preview_50 = CustomPreview(Geometry=line_sdl_65, Material=create_material_48)
custom_preview_51 = CustomPreview(Geometry=interpolate_38.Curve, Material=create_material_49)

polyline_9 = PolyLine(Vertices=curvature_33.Point, Closed=False)
explode_9 = Explode(Curve=polyline_9, Recursive=True)  # -> Segments, Vertices
curve_42 = Curve(flatten(explode_9.Segments))
length_9 = Length(Curve=curve_42)
sort_list_9 = SortList(Keys=length_9, ValuesValuesA=curve_42)  # -> Keys, ValuesValuesA
panel_74 = Panel(sort_list_9.Keys)
list_item_19 = ListItem(List=sort_list_9.Keys, Index=0, Wrap=False)

create_material_51 = CreateMaterial(Diffuse=RGB(235, 235, 235), Specular=RGB(0, 255, 255), Emission=RGB(0, 0, 0), Transparency=0.5, Shine=100)
derivatives_6 = Derivatives(Curve=curve_41, Parameter=divide_curve_47.Parameters)  # -> Point, FirstDerivative, SecondDerivative, ThirdDerivative, FourthDerivative, FifthDerivative, SixthDerivative
number_slider_28 = Slider(42, range=0..256)
curve_43 = Curve(interpolate_38.Curve)
number_23 = Number(number)
divide_curve_48 = DivideCurve(Curve=curve_43, Count=number_23, Kinks=False)  # -> Points, Tangents, Parameters
curvature_34 = Curvature(Curve=curve_43, Parameter=divide_curve_48.Parameters)  # -> Point, Curvature, Curvature_2
deconstruct_arc_34 = DeconstructArc(Arc=curvature_34.Curvature_2)  # -> BasePlane, Radius, Angle
one_over_x_28 = OneOverX(Value=deconstruct_arc_34.Radius)
line_24 = Line(StartPoint=curvature_34.Point, EndPoint=deconstruct_arc_34.BasePlane)
create_material_52 = CreateMaterial(Diffuse=RGB(230, 230, 230), Specular=RGB(0, 255, 255), Emission=RGB(0, 0, 0), Transparency=0.5, Shine=100)
create_material_53 = CreateMaterial(Diffuse=RGB(242, 242, 242), Specular=RGB(0, 255, 255), Emission=RGB(0, 0, 0), Transparency=0.5, Shine=100)

relative_differences_28 = RelativeDifferences(Values=one_over_x_27)
nurbs_curve_20 = NurbsCurve(Vertices=evaluate_length_48.Point, Degree=11, Periodic=False)  # -> Curve, Length, Domain
digit_scroller_40 = DigitScroller(Scroller_Digits=12, Scroller_Prefix="Digit Scroller", Scroller_Radix=1, Scroller_Value=4.411602319)

panel_75 = Panel(relative_differences_28)
quick_graph_32 = QuickGraph(relative_differences_28, SortOrder=0)
multiplication_20 = Multiplication(A=relative_differences_28, B=digit_scroller_40)
line_sdl_66 = LineSDL(Start=evaluate_length_48.Point, Direction=derivatives_6.SecondDerivative, Length=expr("-ABS(X)", multiplication_20))
evaluate_length_49 = EvaluateLength(Curve=line_sdl_66, Length=1, Normalized=True)  # -> Point, Tangent, Parameter
line_sdl_67 = LineSDL(Start=evaluate_length_49.Point, Direction=derivatives_6.ThirdDerivative, Length=expr("-X", multiplication_20))
custom_preview_52 = CustomPreview(Geometry=line_sdl_67, Material=create_material_51)
interpolate_39 = Interpolate(Vertices=evaluate_length_49.Point, Degree=3, Periodic=False, KnotStyle=2)  # -> Curve, Length, Domain
custom_preview_53 = CustomPreview(Geometry=interpolate_39.Curve, Material=create_material_52)
custom_preview_54 = CustomPreview(Geometry=line_sdl_66, Material=create_material_53)

evaluate_length_50 = EvaluateLength(Curve=line_sdl_67, Length=1, Normalized=True)  # -> Point, Tangent, Parameter
interpolate_40 = Interpolate(Vertices=evaluate_length_50.Point, Degree=3, Periodic=False, KnotStyle=2)  # -> Curve, Length, Domain
nurbs_curve_21 = NurbsCurve(Vertices=evaluate_length_50.Point, Degree=11, Periodic=False)  # -> Curve, Length, Domain
nurbs_curve_22 = NurbsCurve(Vertices=evaluate_length_49.Point, Degree=11, Periodic=False)  # -> Curve, Length, Domain
merge_7 = Merge(Data1=evaluate_length_49.Point)
dot_display_5 = DotDisplay(Point=merge_7, Colour=RGB(194, 194, 194), Size=expr("X/2", list_item_19))
