# Grasshopper definition XHG.⠀⠀⠀⠀ⵙ꞉ⵙ◯ⵙᗝⵙꖴⵙⓄⵙᙏⵙᕤᕦⵙꖴⵙᔓᔕⵙ◯ⵙИNⵙⓄⵙꖴⵙ✤ⵙꖴⵙᔓᔕⵙИNⵙᗩⵙᴥⵙ✤ⵙ◯ⵙꗳⵙᙁⵙᗱᗴⵙᔓᔕⵙ◯ⵙᙁⵙᗩⵙᗱᗴⵙᗝⵙꖴⵙ⠀⠀⠀⠀◯⠀⠀⠀⠀ⵙ⠀⠀⠀⠀◯⠀⠀⠀⠀ⵙꖴⵙᗝⵙᗱᗴⵙᗩⵙᙁⵙ◯ⵙᔓᔕⵙᗱᗴⵙᙁⵙꗳⵙ◯ⵙ✤ⵙᴥⵙᗩⵙИNⵙᔓᔕⵙꖴⵙ✤ⵙꖴⵙⓄⵙИNⵙ◯ⵙᔓᔕⵙꖴⵙᕤᕦⵙᙏⵙⓄⵙꖴⵙᗝⵙ◯ⵙ꞉ⵙ⠀⠀⠀⠀.GHX (Grasshopper 1.0.7)
# plug-ins: Pufferfish, Heteroptera

panel = Panel("0.0000710748925500000001421")
panel_2 = Panel("0.0013733120705119695")
panel_4 = Panel("0.00000331207")
panel_5 = Panel("0.00137956207")  # disabled
digit_scroller = DigitScroller(Scroller_Digits=12, Scroller_Prefix="Digit Scroller", Scroller_Radix=1, Scroller_Value=0.02196259374)  # disabled
panel_7 = Panel(digit_scroller)  # disabled
digit_scroller_2 = DigitScroller(Scroller_Digits=12, Scroller_Prefix="Digit Scroller", Scroller_Radix=1, Scroller_Value=7.7777e-05)  # disabled
digit_scroller_3 = DigitScroller(Scroller_Digits=12, Scroller_Prefix=" ", Scroller_Radix=11, Scroller_Value=256)
series = Series(Start=0, Step=expr("1/X", digit_scroller_3), Count=expr("X+1", digit_scroller_3))
expression = Expression(X=series, Expression="-COS(4*ATAN(1)*X)/2+.5")
construct_point = ConstructPoint(XCoordinate=series, YCoordinate=expression, ZCoordinate=0)
interpolate = Interpolate(Vertices=construct_point, Degree=3, Periodic=False, KnotStyle=1)  # -> Curve, Length, Domain; disabled
curve = Curve()
panel_8 = Panel("0.00137956207")
panel_9 = Panel("""0.00032220000
0.00000220000""")
panel_10 = Panel("0.00137956207*4*4*4*4")
digit_scroller_4 = DigitScroller(Scroller_Digits=12, Scroller_Prefix="Digit Scroller", Scroller_Radix=1, Scroller_Value=7.5243e-06)
digit_scroller_5 = DigitScroller(Scroller_Digits=12, Scroller_Prefix="Digit Scroller", Scroller_Radix=1, Scroller_Value=7.7777e-05)
digit_scroller_6 = DigitScroller(Scroller_Digits=12, Scroller_Prefix="Digit Scroller", Scroller_Radix=1, Scroller_Value=0.02196259374)
panel_13 = Panel(digit_scroller_6)
digit_scroller_7 = DigitScroller(Scroller_Digits=12, Scroller_Prefix="Digit Scroller", Scroller_Radix=1, Scroller_Value=7.7777e-05)

create_material = CreateMaterial(Diffuse=RGB(207, 207, 207), Specular=RGB(0, 255, 255), Emission=RGB(0, 0, 0), Transparency=0.5, Shine=100)  # disabled
create_material_2 = CreateMaterial(Diffuse=RGB(232, 232, 232), Specular=RGB(0, 255, 255), Emission=RGB(0, 0, 0), Transparency=0.5, Shine=100)  # disabled
derivatives = Derivatives()  # -> Point, FirstDerivative, SecondDerivative, ThirdDerivative, FourthDerivative, FifthDerivative, SixthDerivative; disabled
quick_graph = QuickGraph(derivatives.SixthDerivative, SortOrder=0)  # disabled
quick_graph_2 = QuickGraph(derivatives.FifthDerivative, SortOrder=0)  # disabled
quick_graph_3 = QuickGraph(derivatives.FourthDerivative, SortOrder=0)  # disabled
quick_graph_4 = QuickGraph(derivatives.ThirdDerivative, SortOrder=0)  # disabled
quick_graph_5 = QuickGraph(derivatives.SecondDerivative, SortOrder=0)  # disabled
quick_graph_6 = QuickGraph(derivatives.FirstDerivative, SortOrder=0)  # disabled
quick_graph_7 = QuickGraph(derivatives.Point, SortOrder=0)  # disabled
line_sdl = LineSDL(Direction=derivatives.ThirdDerivative, Length=expr("-X", 1))  # disabled
evaluate_length = EvaluateLength(Curve=line_sdl, Length=1, Normalized=True)  # -> Point, Tangent, Parameter; disabled
interpolate_2 = Interpolate(Vertices=evaluate_length.Point, Degree=3, Periodic=False, KnotStyle=2)  # -> Curve, Length, Domain; disabled
custom_preview = CustomPreview(Geometry=interpolate_2.Curve, Material=create_material)  # disabled
custom_preview_2 = CustomPreview(Geometry=line_sdl, Material=create_material_2)  # disabled

digit_scroller_8 = DigitScroller(Scroller_Digits=12, Scroller_Prefix="Digit Scroller", Scroller_Radix=1, Scroller_Value=7.5243e-06)
digit_scroller_9 = DigitScroller(Scroller_Digits=12, Scroller_Prefix="Digit Scroller", Scroller_Radix=1, Scroller_Value=7.7777e-05)
digit_scroller_10 = DigitScroller(Scroller_Digits=12, Scroller_Prefix="Digit Scroller", Scroller_Radix=1, Scroller_Value=7.5243e-06)
digit_scroller_11 = DigitScroller(Scroller_Digits=12, Scroller_Prefix="Digit Scroller", Scroller_Radix=1, Scroller_Value=7.7777e-05)
digit_scroller_12 = DigitScroller(Scroller_Digits=12, Scroller_Prefix="Digit Scroller", Scroller_Radix=1, Scroller_Value=0.02196259374)  # disabled
panel_22 = Panel(digit_scroller_12)  # disabled
digit_scroller_13 = DigitScroller(Scroller_Digits=12, Scroller_Prefix="Digit Scroller", Scroller_Radix=1, Scroller_Value=7.7777e-05)  # disabled
panel_24 = Panel("0.00137956207*4*4*4*4")  # disabled
panel_25 = Panel("""0.00032220000
0.00000220000""")  # disabled
digit_scroller_14 = DigitScroller(Scroller_Digits=12, Scroller_Prefix="Digit Scroller", Scroller_Radix=1, Scroller_Value=7.5243e-06)  # disabled
digit_scroller_15 = DigitScroller(Scroller_Digits=12, Scroller_Prefix="Digit Scroller", Scroller_Radix=1, Scroller_Value=7.7777e-05)  # disabled
digit_scroller_16 = DigitScroller(Scroller_Digits=12, Scroller_Prefix="Digit Scroller", Scroller_Radix=1, Scroller_Value=0.02196259374)  # disabled
panel_28 = Panel(digit_scroller_16)  # disabled
digit_scroller_17 = DigitScroller(Scroller_Digits=12, Scroller_Prefix="Digit Scroller", Scroller_Radix=1, Scroller_Value=7.7777e-05)  # disabled
digit_scroller_18 = DigitScroller(Scroller_Digits=12, Scroller_Prefix="Digit Scroller", Scroller_Radix=1, Scroller_Value=0.02196259374)  # disabled
panel_34 = Panel(digit_scroller_18)  # disabled
digit_scroller_19 = DigitScroller(Scroller_Digits=12, Scroller_Prefix="Digit Scroller", Scroller_Radix=1, Scroller_Value=7.7777e-05)  # disabled
digit_scroller_20 = DigitScroller(Scroller_Digits=12, Scroller_Prefix="Digit Scroller", Scroller_Radix=1, Scroller_Value=7.5243e-06)  # disabled
digit_scroller_21 = DigitScroller(Scroller_Digits=12, Scroller_Prefix="Digit Scroller", Scroller_Radix=1, Scroller_Value=7.7777e-05)  # disabled
digit_scroller_22 = DigitScroller(Scroller_Digits=12, Scroller_Prefix="Digit Scroller", Scroller_Radix=1, Scroller_Value=7.5243e-06)  # disabled
digit_scroller_23 = DigitScroller(Scroller_Digits=12, Scroller_Prefix="Digit Scroller", Scroller_Radix=1, Scroller_Value=7.7777e-05)  # disabled
digit_scroller_24 = DigitScroller(Scroller_Digits=12, Scroller_Prefix=" ", Scroller_Radix=1, Scroller_Value=0.03150897256)

digit_scroller_25 = DigitScroller(Scroller_Digits=12, Scroller_Prefix=" ", Scroller_Radix=2, Scroller_Value=16)
number_slider = Slider(1, range=0..1)
number = Number(digit_scroller_24)
number_2 = Number(digit_scroller_25)

digit_scroller_26 = DigitScroller(Scroller_Digits=12, Scroller_Prefix=" ", Scroller_Radix=2, Scroller_Value=0)  # disabled
digit_scroller_27 = DigitScroller(Scroller_Digits=12, Scroller_Prefix=" ", Scroller_Radix=2, Scroller_Value=30.9312132)  # disabled
panel_38 = Panel("16.93121320041889709")  # disabled
stream_filter = StreamFilter(Gate=number_slider)  # disabled
curve_2 = Curve(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)  # disabled
curve_3 = Curve(stream_filter)  # disabled
scale = Scale(Geometry=curve_3, Center=Point(0, 0, 0), Factor=expr("2^X", number_2))  # -> Geometry, Transform; disabled
curve_4 = Curve(scale.Geometry)  # disabled
curve_5 = Curve(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)  # disabled

digit_scroller_28 = DigitScroller(Scroller_Digits=12, Scroller_Prefix=" ", Scroller_Radix=2, Scroller_Value=0)  # disabled
panel_39 = Panel("30.93121320041889709")  # disabled
stream_filter_2 = StreamFilter(Gate=number_slider)  # disabled
curve_6 = Curve(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)  # disabled
curve_7 = Curve(stream_filter_2)  # disabled
scale_2 = Scale(Geometry=curve_7, Center=Point(0, 0, 0), Factor=expr("2^X", number_2))  # -> Geometry, Transform; disabled
curve_8 = Curve(scale_2.Geometry)  # disabled
curve_9 = Curve(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)  # disabled

digit_scroller_29 = DigitScroller(Scroller_Digits=12, Scroller_Prefix=" ", Scroller_Radix=2, Scroller_Value=1)
number_slider_2 = Slider(1, range=0..1)
digit_scroller_30 = DigitScroller(Scroller_Digits=12, Scroller_Prefix="Digit Scroller", Scroller_Radix=1, Scroller_Value=7.5243e-06)  # disabled
digit_scroller_31 = DigitScroller(Scroller_Digits=12, Scroller_Prefix="Digit Scroller", Scroller_Radix=1, Scroller_Value=7.7777e-05)  # disabled
digit_scroller_32 = DigitScroller(Scroller_Digits=12, Scroller_Prefix="Digit Scroller", Scroller_Radix=1, Scroller_Value=7.5243e-06)  # disabled
digit_scroller_33 = DigitScroller(Scroller_Digits=12, Scroller_Prefix="Digit Scroller", Scroller_Radix=1, Scroller_Value=7.7777e-05)  # disabled
digit_scroller_34 = DigitScroller(Scroller_Digits=12, Scroller_Prefix=" ", Scroller_Radix=2, Scroller_Value=0)  # disabled
digit_scroller_35 = DigitScroller(Scroller_Digits=12, Scroller_Prefix="Digit Scroller", Scroller_Radix=1, Scroller_Value=0.02196259374)  # disabled
panel_49 = Panel(digit_scroller_35)  # disabled
digit_scroller_36 = DigitScroller(Scroller_Digits=12, Scroller_Prefix="Digit Scroller", Scroller_Radix=1, Scroller_Value=7.7777e-05)  # disabled

digit_scroller_37 = DigitScroller(Scroller_Digits=12, Scroller_Prefix=" ", Scroller_Radix=2, Scroller_Value=0)  # disabled
digit_scroller_38 = DigitScroller(Scroller_Digits=12, Scroller_Prefix=" ", Scroller_Radix=2, Scroller_Value=30.9312132)  # disabled
curve_10 = Curve(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)  # disabled
curve_11 = Curve(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)  # disabled

panel_51 = Panel("""0    256    0.0013733120705119695
0    4096    0.0000053644183496292""")
digit_scroller_39 = DigitScroller(Scroller_Digits=12, Scroller_Prefix=" ", Scroller_Radix=11, Scroller_Value=64)
digit_scroller_40 = DigitScroller(Scroller_Digits=12, Scroller_Prefix="Digit Scroller", Scroller_Radix=1, Scroller_Value=5.243e-07)
number_3 = Number(digit_scroller_29)

digit_scroller_41 = DigitScroller(Scroller_Digits=12, Scroller_Prefix="Digit Scroller", Scroller_Radix=5, Scroller_Value=9817.028383)

digit_scroller_42 = DigitScroller(Scroller_Digits=12, Scroller_Prefix="Digit Scroller", Scroller_Radix=4, Scroller_Value=532.5234381)

digit_scroller_43 = DigitScroller(Scroller_Digits=12, Scroller_Prefix="Digit Scroller", Scroller_Radix=4, Scroller_Value=34.08106675)
line_sdl_2 = LineSDL(Start=Point(-2.121093912, 1.99985794, 0), Direction=Vector(0.0625, 0.0625, 0), Length=1)

digit_scroller_44 = DigitScroller(Scroller_Digits=12, Scroller_Prefix="Digit Scroller", Scroller_Radix=3, Scroller_Value=0.0689)
line_sdl_3 = LineSDL(Start=Point(0, 0, 0), Direction=Vector(1, 0, 0), Length=1)

digit_scroller_45 = DigitScroller(Scroller_Digits=12, Scroller_Prefix="Digit Scroller", Scroller_Radix=6, Scroller_Value=383463.9766)  # disabled

digit_scroller_46 = DigitScroller(Scroller_Digits=12, Scroller_Prefix="Digit Scroller", Scroller_Radix=3, Scroller_Value=1.892015)

digit_scroller_47 = DigitScroller(Scroller_Digits=12, Scroller_Prefix="Digit Scroller", Scroller_Radix=5, Scroller_Value=56336.19681)  # disabled

digit_scroller_48 = DigitScroller(Scroller_Digits=12, Scroller_Prefix="Digit Scroller", Scroller_Radix=6, Scroller_Value=271915.0063)  # disabled

digit_scroller_49 = DigitScroller(Scroller_Digits=12, Scroller_Prefix="Digit Scroller", Scroller_Radix=7, Scroller_Value=2183007.899)  # disabled

panel_52 = Panel("0.0013733120705119695*4*4")

digit_scroller_50 = DigitScroller(Scroller_Digits=12, Scroller_Prefix="Digit Scroller", Scroller_Radix=1, Scroller_Value=7.49e-08)
radians = Radians(Degrees=number)

create_material_3 = CreateMaterial(Diffuse=RGB(191, 191, 191), Specular=RGB(0, 255, 255), Emission=RGB(0, 0, 0), Transparency=0.5, Shine=100)

create_material_4 = CreateMaterial(Diffuse=RGB(217, 217, 217), Specular=RGB(0, 255, 255), Emission=RGB(0, 0, 0), Transparency=0.5, Shine=100)

create_material_5 = CreateMaterial(Diffuse=RGB(199, 199, 199), Specular=RGB(0, 255, 255), Emission=RGB(0, 0, 0), Transparency=0.5, Shine=100)

create_material_6 = CreateMaterial(Diffuse=RGB(224, 224, 224), Specular=RGB(0, 255, 255), Emission=RGB(0, 0, 0), Transparency=0.5, Shine=100)

create_material_7 = CreateMaterial(Diffuse=RGB(207, 207, 207), Specular=RGB(0, 255, 255), Emission=RGB(0, 0, 0), Transparency=0.5, Shine=100)

create_material_8 = CreateMaterial(Diffuse=RGB(232, 232, 232), Specular=RGB(0, 255, 255), Emission=RGB(0, 0, 0), Transparency=0.5, Shine=100)

create_material_9 = CreateMaterial(Diffuse=RGB(214, 214, 214), Specular=RGB(0, 255, 255), Emission=RGB(0, 0, 0), Transparency=0.5, Shine=100)

create_material_10 = CreateMaterial(Diffuse=RGB(240, 240, 240), Specular=RGB(0, 255, 255), Emission=RGB(0, 0, 0), Transparency=0.5, Shine=100)

create_material_11 = CreateMaterial(Diffuse=RGB(222, 222, 222), Specular=RGB(0, 255, 255), Emission=RGB(0, 0, 0), Transparency=0.5, Shine=100)

create_material_12 = CreateMaterial(Diffuse=RGB(247, 247, 247), Specular=RGB(0, 255, 255), Emission=RGB(0, 0, 0), Transparency=0.5, Shine=100)

create_material_13 = CreateMaterial(Diffuse=RGB(161, 161, 161), Specular=RGB(0, 255, 255), Emission=RGB(0, 0, 0), Transparency=0.5, Shine=100)  # disabled

create_material_14 = CreateMaterial(Diffuse=RGB(186, 186, 186), Specular=RGB(0, 255, 255), Emission=RGB(0, 0, 0), Transparency=0.5, Shine=100)  # disabled

create_material_15 = CreateMaterial(Diffuse=RGB(168, 168, 168), Specular=RGB(0, 255, 255), Emission=RGB(0, 0, 0), Transparency=0.5, Shine=100)  # disabled

create_material_16 = CreateMaterial(Diffuse=RGB(194, 194, 194), Specular=RGB(0, 255, 255), Emission=RGB(0, 0, 0), Transparency=0.5, Shine=100)  # disabled

create_material_17 = CreateMaterial(Diffuse=RGB(184, 184, 184), Specular=RGB(0, 255, 255), Emission=RGB(0, 0, 0), Transparency=0.5, Shine=100)  # disabled

create_material_18 = CreateMaterial(Diffuse=RGB(209, 209, 209), Specular=RGB(0, 255, 255), Emission=RGB(0, 0, 0), Transparency=0.5, Shine=100)  # disabled

digit_scroller_51 = DigitScroller(Scroller_Digits=12, Scroller_Prefix=" ", Scroller_Radix=7, Scroller_Value=4)

create_material_19 = CreateMaterial(Diffuse=RGB(176, 176, 176), Specular=RGB(0, 255, 255), Emission=RGB(0, 0, 0), Transparency=0.5, Shine=100)  # disabled

create_material_20 = CreateMaterial(Diffuse=RGB(201, 201, 201), Specular=RGB(0, 255, 255), Emission=RGB(0, 0, 0), Transparency=0.5, Shine=100)  # disabled

panel_53 = Panel("0.35721403168191375/4/4")  # disabled
panel_54 = Panel("""1    16    0.35721403168191375
1    256    0.0014014999884235925
1    4096    """)
digit_scroller_52 = DigitScroller(Scroller_Digits=12, Scroller_Prefix="Digit Scroller", Scroller_Radix=1, Scroller_Value=0.00140149998)  # disabled
number_slider_3 = Slider(256, range=0..65536)  # disabled
number_4 = Number(digit_scroller_29)  # disabled

digit_scroller_53 = DigitScroller(Scroller_Digits=12, Scroller_Prefix=" ", Scroller_Radix=7, Scroller_Value=16)  # disabled

vector_xyz = VectorXYZ(XComponent=0, YComponent=4, ZComponent=0)  # -> Vector, Length; disabled

number_slider_4 = Slider(1, range=0..1)  # disabled

curve_12 = Curve(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)  # disabled

digit_scroller_54 = DigitScroller(Scroller_Digits=12, Scroller_Prefix=" ", Scroller_Radix=2, Scroller_Value=0)
panel_55 = Panel("30.93121320041889709")
panel_56 = Panel("16.93121320041889709")
curve_13 = Curve(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)
curve_14 = Curve(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)

digit_scroller_55 = DigitScroller(Scroller_Digits=12, Scroller_Prefix=" ", Scroller_Radix=2, Scroller_Value=0)
digit_scroller_56 = DigitScroller(Scroller_Digits=12, Scroller_Prefix=" ", Scroller_Radix=2, Scroller_Value=30.9312132)
curve_15 = Curve(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)
curve_16 = Curve(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)

panel_58 = Panel("0.35721403168191375/4/4")
number_5 = Number(digit_scroller_29)

digit_scroller_57 = DigitScroller(Scroller_Digits=12, Scroller_Prefix="Digit Scroller", Scroller_Radix=1, Scroller_Value=0.00140149998)
number_slider_5 = Slider(256, range=0..65536)
number_6 = Number(digit_scroller_29)

digit_scroller_58 = DigitScroller(Scroller_Digits=12, Scroller_Prefix="Digit Scroller", Scroller_Radix=1, Scroller_Value=0.00140149998)
number_slider_6 = Slider(1, range=0..1)
number_slider_7 = Slider(256, range=0..65536)
radians_2 = Radians(Degrees=number)

expression_2 = Expression(O=radians_2, Expression="FORMAT(\"{0:0.00000000000000000000}\",O)")
panel_62 = Panel(expression_2)
curve_17 = Curve(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)

digit_scroller_59 = DigitScroller(Scroller_Digits=12, Scroller_Prefix=" ", Scroller_Radix=7, Scroller_Value=4)

digit_scroller_60 = DigitScroller(Scroller_Digits=12, Scroller_Prefix=" ", Scroller_Radix=7, Scroller_Value=16)

vector_xyz_2 = VectorXYZ(XComponent=2.5, YComponent=4, ZComponent=0)  # -> Vector, Length

number_slider_8 = Slider(1, range=0..1)

curve_18 = Curve(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)

digit_scroller_61 = DigitScroller(Scroller_Digits=12, Scroller_Prefix=" ", Scroller_Radix=2, Scroller_Value=0)
curve_19 = Curve(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)
curve_20 = Curve(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)

number_7 = Number(digit_scroller_29)

digit_scroller_62 = DigitScroller(Scroller_Digits=12, Scroller_Prefix="Digit Scroller", Scroller_Radix=1, Scroller_Value=0.00140149998)
number_slider_9 = Slider(1, range=0..1)
number_slider_10 = Slider(256, range=0..65536)
radians_3 = Radians(Degrees=number)

expression_3 = Expression(O=radians_3, Expression="FORMAT(\"{0:0.00000000000000000000}\",O)")
panel_67 = Panel(expression_3)
curve_21 = Curve(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)

digit_scroller_63 = DigitScroller(Scroller_Digits=12, Scroller_Prefix=" ", Scroller_Radix=7, Scroller_Value=4)

digit_scroller_64 = DigitScroller(Scroller_Digits=12, Scroller_Prefix=" ", Scroller_Radix=2, Scroller_Value=0)
curve_22 = Curve(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)
curve_23 = Curve(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)

number_8 = Number(digit_scroller_29)

digit_scroller_65 = DigitScroller(Scroller_Digits=12, Scroller_Prefix="Digit Scroller", Scroller_Radix=1, Scroller_Value=0.00140149998)
number_slider_11 = Slider(1, range=0..1)
number_slider_12 = Slider(256, range=0..65536)
radians_4 = Radians(Degrees=number)

expression_4 = Expression(O=radians_4, Expression="FORMAT(\"{0:0.00000000000000000000}\",O)")
panel_72 = Panel(expression_4)
curve_24 = Curve(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)

digit_scroller_66 = DigitScroller(Scroller_Digits=12, Scroller_Prefix=" ", Scroller_Radix=7, Scroller_Value=4)

panel_74 = Panel("""1    16    0.35721403168191375
1    256    0.0014014999884235925
1    4096    """)  # disabled
digit_scroller_67 = DigitScroller(Scroller_Digits=12, Scroller_Prefix="Digit Scroller", Scroller_Radix=1, Scroller_Value=0.00140149998)  # disabled
number_slider_13 = Slider(256, range=0..65536)  # disabled
number_9 = Number(digit_scroller_29)  # disabled

digit_scroller_68 = DigitScroller(Scroller_Digits=12, Scroller_Prefix=" ", Scroller_Radix=7, Scroller_Value=16)  # disabled

vector_xyz_3 = VectorXYZ(XComponent=5, YComponent=4, ZComponent=0)  # -> Vector, Length; disabled

number_slider_14 = Slider(1, range=0..1)  # disabled
end_points = EndPoints(Curve=curve_4)  # -> Start, End; disabled
rectangle_2pt = Rectangle2Pt(Plane=PlaneXY(0, 0, 0), PointA=end_points.Start, PointB=end_points.End, Radius=0)  # -> Rectangle, Length; disabled

curve_25 = Curve(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)  # disabled

digit_scroller_69 = DigitScroller(Scroller_Digits=12, Scroller_Prefix=" ", Scroller_Radix=2, Scroller_Value=0.0833333333)

digit_scroller_70 = DigitScroller(Scroller_Digits=12, Scroller_Prefix=" ", Scroller_Radix=1, Scroller_Value=0.09375)

digit_scroller_71 = DigitScroller(Scroller_Digits=12, Scroller_Prefix=" ", Scroller_Radix=11, Scroller_Value=256)
digit_scroller_72 = DigitScroller(Scroller_Digits=12, Scroller_Prefix=" ", Scroller_Radix=11, Scroller_Value=87)
digit_scroller_73 = DigitScroller(Scroller_Digits=12, Scroller_Prefix=" ", Scroller_Radix=1, Scroller_Value=0.32125)
create_material_21 = CreateMaterial(Diffuse=RGB(222, 222, 222), Specular=RGB(0, 255, 255), Emission=RGB(0, 0, 0), Transparency=0.5, Shine=100)
create_material_22 = CreateMaterial(Diffuse=RGB(247, 247, 247), Specular=RGB(0, 255, 255), Emission=RGB(0, 0, 0), Transparency=0.5, Shine=100)
create_material_23 = CreateMaterial(Diffuse=RGB(176, 176, 176), Specular=RGB(0, 255, 255), Emission=RGB(0, 0, 0), Transparency=0.5, Shine=100)

digit_scroller_74 = DigitScroller(Scroller_Digits=12, Scroller_Prefix=" ", Scroller_Radix=3, Scroller_Value=0.166666666)

digit_scroller_75 = DigitScroller(Scroller_Digits=12, Scroller_Prefix=" ", Scroller_Radix=3, Scroller_Value=1000)

digit_scroller_76 = DigitScroller(Scroller_Digits=12, Scroller_Prefix=" ", Scroller_Radix=2, Scroller_Value=8.55)

digit_scroller_77 = DigitScroller(Scroller_Digits=12, Scroller_Prefix=" ", Scroller_Radix=1, Scroller_Value=0.03125)

digit_scroller_78 = DigitScroller(Scroller_Digits=12, Scroller_Prefix=" ", Scroller_Radix=1, Scroller_Value=2.50125)

create_material_24 = CreateMaterial(Diffuse=RGB(176, 176, 176), Specular=RGB(0, 255, 255), Emission=RGB(0, 0, 0), Transparency=0.5, Shine=100)
create_material_25 = CreateMaterial(Diffuse=RGB(201, 201, 201), Specular=RGB(0, 255, 255), Emission=RGB(0, 0, 0), Transparency=0.5, Shine=100)

create_material_26 = CreateMaterial(Diffuse=RGB(176, 176, 176), Specular=RGB(0, 255, 255), Emission=RGB(0, 0, 0), Transparency=0.5, Shine=100)
create_material_27 = CreateMaterial(Diffuse=RGB(201, 201, 201), Specular=RGB(0, 255, 255), Emission=RGB(0, 0, 0), Transparency=0.5, Shine=100)

create_material_28 = CreateMaterial(Diffuse=RGB(184, 184, 184), Specular=RGB(0, 255, 255), Emission=RGB(0, 0, 0), Transparency=0.5, Shine=100)
create_material_29 = CreateMaterial(Diffuse=RGB(209, 209, 209), Specular=RGB(0, 255, 255), Emission=RGB(0, 0, 0), Transparency=0.5, Shine=100)

create_material_30 = CreateMaterial(Diffuse=RGB(191, 191, 191), Specular=RGB(0, 255, 255), Emission=RGB(0, 0, 0), Transparency=0.5, Shine=100)
create_material_31 = CreateMaterial(Diffuse=RGB(217, 217, 217), Specular=RGB(0, 255, 255), Emission=RGB(0, 0, 0), Transparency=0.5, Shine=100)

create_material_32 = CreateMaterial(Diffuse=RGB(199, 199, 199), Specular=RGB(0, 255, 255), Emission=RGB(0, 0, 0), Transparency=0.5, Shine=100)
create_material_33 = CreateMaterial(Diffuse=RGB(224, 224, 224), Specular=RGB(0, 255, 255), Emission=RGB(0, 0, 0), Transparency=0.5, Shine=100)

create_material_34 = CreateMaterial(Diffuse=RGB(207, 207, 207), Specular=RGB(0, 255, 255), Emission=RGB(0, 0, 0), Transparency=0.5, Shine=100)
create_material_35 = CreateMaterial(Diffuse=RGB(232, 232, 232), Specular=RGB(0, 255, 255), Emission=RGB(0, 0, 0), Transparency=0.5, Shine=100)

create_material_36 = CreateMaterial(Diffuse=RGB(214, 214, 214), Specular=RGB(0, 255, 255), Emission=RGB(0, 0, 0), Transparency=0.5, Shine=100)
create_material_37 = CreateMaterial(Diffuse=RGB(240, 240, 240), Specular=RGB(0, 255, 255), Emission=RGB(0, 0, 0), Transparency=0.5, Shine=100)

digit_scroller_79 = DigitScroller(Scroller_Digits=12, Scroller_Prefix=" ", Scroller_Radix=2, Scroller_Value=0)  # disabled
digit_scroller_80 = DigitScroller(Scroller_Digits=12, Scroller_Prefix=" ", Scroller_Radix=2, Scroller_Value=30.9312132)  # disabled
curve_26 = Curve(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)  # disabled
curve_27 = Curve(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)  # disabled

button = Button()  # disabled
file_path = FilePath("C:\VSC.O____STNEMGES_215____ERUTAWRUC_RAENIL_DEPAM_EMIT_1_HTOMS_LEVEL_4_DIOMGIS_NOITISNART_EGDE_LUF____O____FUL_EDGE_TRANSITION_SIGMOID_4_LEVEL_SMOTH_1_TIME_MAPED_LINEAR_CURWATURE____512_SEGMENTS____O.CSV")  # disabled

digit_scroller_81 = DigitScroller(Scroller_Digits=12, Scroller_Prefix="Digit Scroller", Scroller_Radix=1, Scroller_Value=0.00140149998)  # disabled
radians_5 = Radians(Degrees=number)  # disabled
number_slider_15 = Slider(256, range=0..65536)  # disabled
number_10 = Number(digit_scroller_29)  # disabled

expression_5 = Expression(O=radians_5, Expression="FORMAT(\"{0:0.00000000000000000000}\",O)")  # disabled
panel_78 = Panel(expression_5)  # disabled
curve_28 = Curve(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)  # disabled

digit_scroller_82 = DigitScroller(Scroller_Digits=12, Scroller_Prefix="Digit Scroller", Scroller_Radix=1, Scroller_Value=0.00140149998)  # disabled
number_slider_16 = Slider(256, range=0..65536)  # disabled
number_11 = Number(digit_scroller_29)  # disabled

digit_scroller_83 = DigitScroller(Scroller_Digits=12, Scroller_Prefix=" ", Scroller_Radix=7, Scroller_Value=16)  # disabled

number_slider_17 = Slider(1, range=0..1)  # disabled
end_points_2 = EndPoints(Curve=curve_8)  # -> Start, End; disabled
rectangle_2pt_2 = Rectangle2Pt(Plane=PlaneXY(0, 0, 0), PointA=end_points_2.Start, PointB=end_points_2.End, Radius=0)  # -> Rectangle, Length; disabled

digit_scroller_84 = DigitScroller(Scroller_Digits=12, Scroller_Prefix=" ", Scroller_Radix=7, Scroller_Value=16)  # disabled

vector_xyz_4 = VectorXYZ(XComponent=7.5, YComponent=4, ZComponent=0)  # -> Vector, Length; disabled

number_slider_18 = Slider(1, range=0..1)  # disabled

curve_29 = Curve(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)  # disabled

digit_scroller_85 = DigitScroller(Scroller_Digits=12, Scroller_Prefix="Digit Scroller", Scroller_Radix=11, Scroller_Value=16)  # disabled
construct_point_2 = ConstructPoint(XCoordinate=0.5, YCoordinate=0.5, ZCoordinate=0)  # -> flatten(Point); disabled
line_sdl_4 = LineSDL(Start=Point(0, 0, 0), Direction=Vector(1, 0, 0), Length=expr("X/2", 1))  # disabled
button_2 = Button()  # disabled
file_path_2 = FilePath("C:\IICSA.O__4201_EDIWID_1_TNEMERCNI__TNEIDARG_PUKOOL_ROLOC_HTOMS_3_DIOMGIS_ERUTAWRUC_RAENIL_DEPAM_4_NOITISNART_EGDE_LUF_EKUN__O__NUKE_FUL_EDGE_TRANSITION_4_MAPED_LINEAR_CURWATURE_SIGMOID_3_SMOTH_COLOR_LOOKUP_GRADIENT__INCREMENT_1_DIWIDE_1024__O.ASCII")  # disabled
number_12 = Number(digit_scroller_85)  # disabled

vector_xyz_5 = VectorXYZ(XComponent=7.5, YComponent=1.5, ZComponent=0)  # -> Vector, Length; disabled

button_3 = Button()  # disabled
file_path_3 = FilePath("C:\VSC.O____STNEMGES_4201____HTOMS_LEVEL_3_DIOMGIS_ERUTAWRUC_RAENIL_DEPAM_SEMIT_4_NOITISNART_EGDE_LUF____O____FUL_EDGE_TRANSITION_4_TIMES_MAPED_LINEAR_CURWATURE_SIGMOID_3_LEVEL_SMOTH____1024_SEGMENTS____O.CSV")  # disabled

digit_scroller_86 = DigitScroller(Scroller_Digits=12, Scroller_Prefix=" ", Scroller_Radix=2, Scroller_Value=30.9312132)  # disabled
digit_scroller_87 = DigitScroller(Scroller_Digits=12, Scroller_Prefix=" ", Scroller_Radix=2, Scroller_Value=0)  # disabled
curve_30 = Curve(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)  # disabled
curve_31 = Curve(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)  # disabled

digit_scroller_88 = DigitScroller(Scroller_Digits=12, Scroller_Prefix=" ", Scroller_Radix=2, Scroller_Value=0)  # disabled
curve_32 = Curve(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)  # disabled
curve_33 = Curve(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)  # disabled

digit_scroller_89 = DigitScroller(Scroller_Digits=12, Scroller_Prefix="Digit Scroller", Scroller_Radix=1, Scroller_Value=0.00140149998)  # disabled
number_slider_19 = Slider(256, range=0..65536)  # disabled

digit_scroller_90 = DigitScroller(Scroller_Digits=12, Scroller_Prefix="Digit Scroller", Scroller_Radix=1, Scroller_Value=0.00140149998)  # disabled
number_slider_20 = Slider(256, range=0..65536)  # disabled
radians_6 = Radians(Degrees=number)  # disabled

expression_6 = Expression(O=radians_6, Expression="FORMAT(\"{0:0.00000000000000000000}\",O)")  # disabled
panel_88 = Panel(expression_6)  # disabled
curve_34 = Curve(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)  # disabled

digit_scroller_91 = DigitScroller(Scroller_Digits=12, Scroller_Prefix=" ", Scroller_Radix=7, Scroller_Value=16)  # disabled

vector_xyz_6 = VectorXYZ(XComponent=10, YComponent=4, ZComponent=0)  # -> Vector, Length; disabled

digit_scroller_92 = DigitScroller(Scroller_Digits=12, Scroller_Prefix=" ", Scroller_Radix=7, Scroller_Value=16)  # disabled

number_slider_21 = Slider(1, range=0..1)  # disabled

number_slider_22 = Slider(1, range=0..1)  # disabled

curve_35 = Curve(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)  # disabled

number_slider_23 = Slider(0, range=0..1)  # disabled
button_4 = Button()  # disabled
file_path_4 = FilePath("C:\VSC.O____EPAHS_LANGIS____STNEMGES_4201____HTOMS_LEVEL_3_DIOMGIS_ERUTAWRUC_RAENIL_DEPAM_SEMIT_4_NOITISNART_EGDE_LUF____O____FUL_EDGE_TRANSITION_4_TIMES_MAPED_LINEAR_CURWATURE_SIGMOID_3_LEVEL_SMOTH____1024_SEGMENTS____SIGNAL_SHAPE____O.CSV")  # disabled

vector_xyz_7 = VectorXYZ(XComponent=10, YComponent=1.5, ZComponent=0)  # -> Vector, Length; disabled

digit_scroller_93 = DigitScroller(Scroller_Digits=12, Scroller_Prefix=" ", Scroller_Radix=2, Scroller_Value=0)  # disabled
curve_36 = Curve(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)  # disabled
curve_37 = Curve(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)  # disabled

digit_scroller_94 = DigitScroller(Scroller_Digits=12, Scroller_Prefix="Digit Scroller", Scroller_Radix=1, Scroller_Value=0.00140149998)  # disabled
number_slider_24 = Slider(256, range=0..65536)  # disabled
radians_7 = Radians(Degrees=number)  # disabled

expression_7 = Expression(O=radians_7, Expression="FORMAT(\"{0:0.00000000000000000000}\",O)")  # disabled
panel_93 = Panel(expression_7)  # disabled
curve_38 = Curve(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)  # disabled

digit_scroller_95 = DigitScroller(Scroller_Digits=12, Scroller_Prefix=" ", Scroller_Radix=7, Scroller_Value=16)  # disabled

number_slider_25 = Slider(1, range=0..1)  # disabled

digit_scroller_96 = DigitScroller(Scroller_Digits=12, Scroller_Prefix=" ", Scroller_Radix=1, Scroller_Value=0.0054935044)
panel_94 = Panel("""128    0.00549350440
256    0.001373312102167""")
panel_95 = Panel("0.001373312102167*4")

radians_8 = Radians(Degrees=digit_scroller_96)  # disabled

expression_8 = Expression(O=radians_8, Expression="FORMAT(\"{0:0.00000000000000000000}\",O)")  # disabled
panel_96 = Panel(expression_8)  # disabled

radians_9 = Radians(Degrees=digit_scroller_96)

expression_9 = Expression(O=radians_9, Expression="FORMAT(\"{0:0.00000000000000000000}\",O)")
panel_97 = Panel(expression_9)

radians_10 = Radians(Degrees=digit_scroller_96)  # disabled

expression_10 = Expression(O=radians_10, Expression="FORMAT(\"{0:0.00000000000000000000}\",O)")  # disabled
panel_98 = Panel(expression_10)  # disabled

radians_11 = Radians(Degrees=digit_scroller_96)  # disabled

expression_11 = Expression(O=radians_11, Expression="FORMAT(\"{0:0.00000000000000000000}\",O)")  # disabled
panel_99 = Panel(expression_11)  # disabled

radians_12 = Radians(Degrees=digit_scroller_96)  # disabled

expression_12 = Expression(O=radians_12, Expression="FORMAT(\"{0:0.00000000000000000000}\",O)")  # disabled
panel_100 = Panel(expression_12)  # disabled

digit_scroller_97 = DigitScroller(Scroller_Digits=12, Scroller_Prefix=" ", Scroller_Radix=11, Scroller_Value=32)
multiplication = Multiplication(A=digit_scroller_97, B=2)

addition = Addition(A=multiplication, B=1)

panel_101 = Panel(addition)

number_13 = Number(panel_101)  # disabled

number_14 = Number(panel_101)

number_15 = Number(number_14)
number_16 = Number(number_15)

expression_13 = Expression(X=number_14, O=number_3, Expression="(X-1)^O")

duplicate_data = DuplicateData(Data=expression_13, Number=number_14, Order=True)
series_2 = Series(Start=0, Step=radians, Count=number_14)

list_length = ListLength(List=duplicate_data)
construct_domain = ConstructDomain(DomainStart="0", DomainEnd=expr("X-2", list_length))
range = Range(Domain=construct_domain, Steps=expr("X-2", list_length))
list_item = ListItem(List=duplicate_data, Index=range, Wrap=False)
panel_102 = Panel(list_item)

reverse_list = ReverseList(List=series_2)

list_length_2 = ListLength(List=reverse_list)
construct_domain_2 = ConstructDomain(DomainStart=0, DomainEnd=expr("X-2", list_length_2))
range_2 = Range(Domain=construct_domain_2, Steps=expr("X-2", list_length_2))
list_item_2 = ListItem(List=reverse_list, Index=range_2, Wrap=False)
panel_103 = Panel(list_item_2)

turtle = DotNETVBScriptLEGACY(Forward=list_item, Left=list_item_2)  # -> Output, Points; inputs Forward: list, Left: list
# ---------- turtle: VB ----------
    Dim i As Integer
    Dim dir As New On3dVector(1, 0, 0)    
    Dim pos As New On3dVector(0, 0, 0) 
    Dim axis As New On3dVector(0, 0, 1)
    Dim pnts As New List(Of On3dVector)

    pnts.Add(pos)
    
    For i = 0 To Forward.Count() - 1
      Dim P As New On3dVector
      dir.Rotate(Left(i), axis)      
      P = dir * Forward(i) + pnts(i)
      pnts.Add(P)
    Next
    
    Points = pnts
# ---------- end turtle ----------
point = Point(turtle.Points)

scale_3 = Scale(Geometry=point, Center=Point(0, 0, 0), Factor=expr("2^X", digit_scroller_51))  # -> Geometry, Transform

interpolate_t = InterpolateT(Vertices=scale_3.Geometry, TangentStart=Vector(0, 0, 0), TangentEnd=Vector(0, 0, 0), KnotStyle=2)  # -> Curve, Length, Domain
evaluate_length_2 = EvaluateLength(Curve=interpolate_t.Curve, Length=1, Normalized=True)  # -> Point, Tangent, Parameter
rotate = Rotate(Geometry=interpolate_t.Curve, Angle=3.141592654, Plane=evaluate_length_2.Point)  # -> Geometry, Transform
join_curves = JoinCurves(Curves=[interpolate_t.Curve, rotate.Geometry], Preserve=False)
curve_39 = Curve(join_curves)

expression_14 = Expression(O=turtle.Points, Expression="FORMAT(\"{0:R}\",O)")
expression_15 = Expression(O=list_item_2, Expression="FORMAT(\"{0:R}\",O)")
panel_104 = Panel(expression_15)
evaluate_length_3 = EvaluateLength(Curve=join_curves, Length=1, Normalized=True)  # -> Point, Tangent, Parameter
deconstruct = Deconstruct(Point=evaluate_length_3.Point)  # -> XComponent, YComponent, ZComponent
expression_16 = Expression(O=deconstruct.YComponent, Expression="FORMAT(\"{0:R}\",O)")
expression_17 = Expression(O=deconstruct.XComponent, Expression="FORMAT(\"{0:R}\",O)")
expression_18 = Expression(O=deconstruct.ZComponent, Expression="FORMAT(\"{0:R}\",O)")
panel_105 = Panel(expression_16)
panel_106 = Panel(expression_17)
panel_107 = Panel(expression_18)
addition_2 = Addition(A=panel_105, B=panel_106)
expression_19 = Expression(O=addition_2, Expression="FORMAT(\"{0:R}\",O)")
panel_108 = Panel(expression_19)
division = Division(A=panel_108, B=2)
expression_20 = Expression(O=division, Expression="FORMAT(\"{0:R}\",O)")
panel_109 = Panel(expression_20)
scale_4 = Scale(Geometry=curve_39, Center=Point(0, 0, 0), Factor=expr("1/X", panel_109))  # -> Geometry, Transform
evaluate_length_4 = EvaluateLength(Curve=scale_4.Geometry, Length=1, Normalized=True)  # -> Point, Tangent, Parameter
deconstruct_2 = Deconstruct(Point=evaluate_length_4.Point)  # -> XComponent, YComponent, ZComponent
expression_21 = Expression(O=deconstruct_2.YComponent, Expression="FORMAT(\"{0:R}\",O)")
expression_22 = Expression(O=deconstruct_2.XComponent, Expression="FORMAT(\"{0:R}\",O)")
expression_23 = Expression(O=deconstruct_2.ZComponent, Expression="FORMAT(\"{0:R}\",O)")
panel_110 = Panel(expression_21)
panel_111 = Panel(expression_22)
panel_112 = Panel(expression_23)
division_2 = Division(A=panel_106, B=panel_105)
expression_24 = Expression(O=division_2, Expression="FORMAT(\"{0:R}\",O)")
panel_113 = Panel(expression_24)
curve_40 = Curve(scale_4.Geometry)

panel_115 = Panel(expression_14)

move = Move(Geometry=curve_40, Motion=Vector(0, 0, 0))  # -> Geometry, Transform; disabled
curve_41 = Curve(move.Geometry)  # disabled
panel_116 = Panel(range_2)
quick_graph_8 = QuickGraph(series_2, SortOrder=0)

curve_42 = Curve(curve_40)
end_points_3 = EndPoints(Curve=curve_42)  # -> Start, End
rectangle_2pt_3 = Rectangle2Pt(Plane=PlaneXY(0, 0, 0), PointA=end_points_3.Start, PointB=end_points_3.End, Radius=0)  # -> Rectangle, Length
deconstuct_rectangle = DeconstuctRectangle(Rectangle=rectangle_2pt_3.Rectangle)  # -> BasePlane, XInterval, YInterval
deconstruct_domain = DeconstructDomain(Domain=deconstuct_rectangle.YInterval)  # -> Start, End
deconstruct_domain_2 = DeconstructDomain(Domain=deconstuct_rectangle.XInterval)  # -> Start, End
scale_nu = ScaleNU(
    Geometry=curve_40,
    Plane=PlaneXY(0, 0, 0),
    ScaleX=expr("1/X", deconstruct_domain_2.End),
    ScaleY=expr("1/X", deconstruct_domain.End),
    ScaleZ=1)  # -> Geometry, Transform
curve_43 = Curve(scale_nu.Geometry)

stream_filter_3 = StreamFilter(Gate=number_slider, Stream0=curve_40, Stream1=curve_43)  # disabled
curve_44 = Curve(stream_filter_3)  # disabled
scale_5 = Scale(Geometry=curve_44, Center=Point(0, 0, 0), Factor=expr("2^X", number_2))  # -> Geometry, Transform; disabled
curve_45 = Curve(scale_5.Geometry)  # disabled

move_2 = Move(Geometry=curve_43, Motion=Vector(0, 1.5, 0))  # -> Geometry, Transform
curve_46 = Curve(move_2.Geometry)
panel_117 = Panel(series_2)

stream_filter_4 = StreamFilter(Gate=number_slider, Stream0=curve_40, Stream1=curve_43)
curve_47 = Curve(stream_filter_4)
scale_6 = Scale(Geometry=curve_47, Center=Point(0, 0, 0), Factor=expr("2^X", number_2))  # -> Geometry, Transform
curve_48 = Curve(scale_6.Geometry)

end_points_4 = EndPoints(Curve=curve_45)  # -> Start, End; disabled
rectangle_2pt_4 = Rectangle2Pt(Plane=PlaneXY(0, 0, 0), PointA=end_points_4.Start, PointB=end_points_4.End, Radius=0)  # -> Rectangle, Length; disabled

number_17 = Number(number_14)  # disabled

series_3 = Series(Start=0, Step=panel_96, Count=number_17)  # disabled
expression_25 = Expression(O=series_3, Expression="FORMAT(\"{0:R}\",O)")  # disabled
panel_118 = Panel(expression_25)  # disabled
bounds = Bounds(Numbers=series_3)  # disabled
expression_26 = Expression(X=number_17, O=number_4, Expression="X^O")  # disabled
duplicate_data_2 = DuplicateData(Data=expression_26, Number=number_17, Order=True)  # disabled

curve_graph_mapper = CurveGraphMapper(Curves=curve_45, Rectangle=rectangle_2pt_4.Rectangle, Values=series_3, Flip=False, Snap=True, TextSize=0.015625)  # -> Mapped, GraphCurves, GraphPoints, ValueLines, ValuePoints, MappedLines, MappedPoints, Boundary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; disabled
graphmapper = GraphMapper(Curve=curve_45, Boundary=rectangle_2pt_4.Rectangle, Numbers=series_3, Input=bounds, Output=bounds, bobo=False)  # disabled
stream_filter_5 = StreamFilter(Gate=number_slider_2, Stream0=curve_graph_mapper.Mapped, Stream1=graphmapper)  # disabled

turtle_2 = DotNETVBScriptLEGACY(Forward=duplicate_data_2, Left=stream_filter_5)  # -> Output, Points; inputs Forward: list, Left: list; disabled; same code as turtle

expression_27 = Expression(O=turtle_2.Points, Expression="FORMAT(\"{0:R}\",O)")  # disabled
panel_119 = Panel(expression_27)  # disabled

point_2 = Point(turtle_2.Points)  # disabled
scale_7 = Scale(Geometry=point_2, Center=Point(0, 0, 0), Factor=expr("2^X", digit_scroller_53))  # -> Geometry, Transform; disabled

interpolate_t_2 = InterpolateT(Vertices=scale_7.Geometry, TangentStart=Vector(0.0625, 0, 0), TangentEnd=Vector(0, 0, 0), KnotStyle=2)  # -> Curve, Length, Domain; disabled
evaluate_length_5 = EvaluateLength(Curve=interpolate_t_2.Curve, Length=1, Normalized=True)  # -> Point, Tangent, Parameter; disabled
line_sdl_5 = LineSDL(Start=evaluate_length_5.Point, Direction=evaluate_length_5.Tangent, Length=1)  # disabled
mirror = Mirror(Geometry=interpolate_t_2.Curve, Plane=line_sdl_5)  # -> Geometry, Transform; disabled
join_curves_2 = JoinCurves(Curves=[interpolate_t_2.Curve, mirror.Geometry], Preserve=False)  # disabled
evaluate_length_6 = EvaluateLength(Curve=join_curves_2, Length=1, Normalized=True)  # -> Point, Tangent, Parameter; disabled
rotate_2 = Rotate(Geometry=join_curves_2, Angle=3.141592654, Plane=evaluate_length_6.Point)  # -> Geometry, Transform; disabled
join_curves_3 = JoinCurves(Curves=[join_curves_2, rotate_2.Geometry], Preserve=False)  # disabled
curve_49 = Curve(join_curves_3)  # disabled

evaluate_length_7 = EvaluateLength(Curve=join_curves_3, Length=1, Normalized=True)  # -> Point, Tangent, Parameter; disabled
deconstruct_3 = Deconstruct(Point=evaluate_length_7.Point)  # -> XComponent, YComponent, ZComponent; disabled
expression_28 = Expression(O=deconstruct_3.YComponent, Expression="FORMAT(\"{0:R}\",O)")  # disabled
expression_29 = Expression(O=deconstruct_3.XComponent, Expression="FORMAT(\"{0:R}\",O)")  # disabled
expression_30 = Expression(O=deconstruct_3.ZComponent, Expression="FORMAT(\"{0:R}\",O)")  # disabled
panel_120 = Panel(expression_28)  # disabled
panel_121 = Panel(expression_29)  # disabled
panel_122 = Panel(expression_30)  # disabled
addition_3 = Addition(A=panel_120, B=panel_121)  # disabled
expression_31 = Expression(O=addition_3, Expression="FORMAT(\"{0:R}\",O)")  # disabled
panel_123 = Panel(expression_31)  # disabled
division_3 = Division(A=panel_123, B=2)  # disabled
expression_32 = Expression(O=division_3, Expression="FORMAT(\"{0:R}\",O)")  # disabled
panel_124 = Panel(expression_32)  # disabled
scale_8 = Scale(Geometry=scale_7.Geometry, Center=Point(0, 0, 0), Factor=expr("1/X", panel_124))  # -> Geometry, Transform; disabled
scale_9 = Scale(Geometry=curve_49, Center=Point(0, 0, 0), Factor=expr("1/X", panel_124))  # -> Geometry, Transform; disabled
evaluate_length_8 = EvaluateLength(Curve=scale_9.Geometry, Length=1, Normalized=True)  # -> Point, Tangent, Parameter; disabled
deconstruct_4 = Deconstruct(Point=evaluate_length_8.Point)  # -> XComponent, YComponent, ZComponent; disabled
expression_33 = Expression(O=deconstruct_4.YComponent, Expression="FORMAT(\"{0:R}\",O)")  # disabled
expression_34 = Expression(O=deconstruct_4.XComponent, Expression="FORMAT(\"{0:R}\",O)")  # disabled
expression_35 = Expression(O=deconstruct_4.ZComponent, Expression="FORMAT(\"{0:R}\",O)")  # disabled
panel_125 = Panel(expression_33)  # disabled
panel_126 = Panel(expression_34)  # disabled
panel_127 = Panel(expression_35)  # disabled
division_4 = Division(A=panel_121, B=panel_120)  # disabled
expression_36 = Expression(O=division_4, Expression="FORMAT(\"{0:R}\",O)")  # disabled
panel_128 = Panel(expression_36)  # disabled
curve_50 = Curve(scale_9.Geometry)  # disabled
point_3 = Point(scale_8.Geometry)  # disabled

move_3 = Move(Geometry=curve_50, Motion=vector_xyz.Vector)  # -> Geometry, Transform; disabled
mirror_2 = Mirror(Geometry=curve_50, Plane=PlaneYZ(0, 0, 0))  # -> Geometry, Transform; disabled
curve_51 = Curve(move_3.Geometry)  # disabled

number_18 = Number(number_16)

number_19 = Number(number_18)
number_20 = Number(expr("X*2", number_19))

number_21 = Number(number_20)

divide_curve = DivideCurve(Curve=line_sdl_3, Count=number_21, Kinks=False)  # -> Points, Tangents, Parameters

end_points_5 = EndPoints(Curve=curve_48)  # -> Start, End
rectangle_2pt_5 = Rectangle2Pt(Plane=PlaneXY(0, 0, 0), PointA=end_points_5.Start, PointB=end_points_5.End, Radius=0)  # -> Rectangle, Length

number_22 = Number(number_14)

series_4 = Series(Start=0, Step=panel_62, Count=number_22)

reverse_list_2 = ReverseList(List=series_4)
expression_37 = Expression(X=number_22, O=number_5, Expression="(X-1)^O")

list_length_3 = ListLength(List=reverse_list_2)
construct_domain_3 = ConstructDomain(DomainStart="0", DomainEnd=expr("X-2", list_length_3))
range_3 = Range(Domain=construct_domain_3, Steps=expr("X-2", list_length_3))
list_item_3 = ListItem(List=reverse_list_2, Index=range_3, Wrap=False)
panel_130 = Panel(list_item_3)

expression_38 = Expression(O=list_item_3, Expression="FORMAT(\"{0:R}\",O)")
panel_131 = Panel(expression_38)
bounds_2 = Bounds(Numbers=list_item_3)

curve_graph_mapper_2 = CurveGraphMapper(Curves=curve_48, Rectangle=rectangle_2pt_5.Rectangle, Values=list_item_3, Flip=False, Snap=True, TextSize=0.015625)  # -> Mapped, GraphCurves, GraphPoints, ValueLines, ValuePoints, MappedLines, MappedPoints, Boundary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; disabled
duplicate_data_3 = DuplicateData(Data=expression_37, Number=expr("X-1", number_22), Order=True)
graphmapper_2 = GraphMapper(Curve=curve_48, Boundary=rectangle_2pt_5.Rectangle, Numbers=list_item_3, Input=bounds_2, Output=bounds_2, bobo=True)
stream_filter_6 = StreamFilter(Gate=number_slider_2, Stream0=curve_graph_mapper_2.Mapped, Stream1=graphmapper_2)

list_length_4 = ListLength(List=duplicate_data_3)
construct_domain_4 = ConstructDomain(DomainStart="0", DomainEnd=expr("X-2", list_length_4))
range_4 = Range(Domain=construct_domain_4, Steps=expr("X-2", list_length_4))
list_item_4 = ListItem(List=duplicate_data_3, Index=range_4, Wrap=False)
panel_132 = Panel(list_item_4)

turtle_3 = DotNETVBScriptLEGACY(Forward=list_item_4, Left=stream_filter_6)  # -> Output, Points; inputs Forward: list, Left: list; same code as turtle
expression_39 = Expression(O=turtle_3.Points, Expression="FORMAT(\"{0:R}\",O)")
panel_133 = Panel(expression_39)

point_4 = Point(turtle_3.Points)
scale_10 = Scale(Geometry=point_4, Center=Point(0, 0, 0), Factor=expr("2^X", digit_scroller_59))  # -> Geometry, Transform

interpolate_t_3 = InterpolateT(Vertices=scale_10.Geometry, TangentStart=Vector(0.0625, 0, 0), TangentEnd=Vector(0, 0, 0), KnotStyle=2)  # -> Curve, Length, Domain
evaluate_length_9 = EvaluateLength(Curve=interpolate_t_3.Curve, Length=1, Normalized=True)  # -> Point, Tangent, Parameter
rotate_3 = Rotate(Geometry=interpolate_t_3.Curve, Angle=3.141592654, Plane=evaluate_length_9.Point)  # -> Geometry, Transform
join_curves_4 = JoinCurves(Curves=[interpolate_t_3.Curve, rotate_3.Geometry], Preserve=False)
curve_52 = Curve(join_curves_4)

evaluate_length_10 = EvaluateLength(Curve=join_curves_4, Length=1, Normalized=True)  # -> Point, Tangent, Parameter
deconstruct_5 = Deconstruct(Point=evaluate_length_10.Point)  # -> XComponent, YComponent, ZComponent
expression_40 = Expression(O=deconstruct_5.YComponent, Expression="FORMAT(\"{0:R}\",O)")
expression_41 = Expression(O=deconstruct_5.XComponent, Expression="FORMAT(\"{0:R}\",O)")
expression_42 = Expression(O=deconstruct_5.ZComponent, Expression="FORMAT(\"{0:R}\",O)")
panel_134 = Panel(expression_40)
panel_135 = Panel(expression_41)
panel_136 = Panel(expression_42)
addition_4 = Addition(A=panel_134, B=panel_135)
expression_43 = Expression(O=addition_4, Expression="FORMAT(\"{0:R}\",O)")
panel_137 = Panel(expression_43)
division_5 = Division(A=panel_137, B=2)
expression_44 = Expression(O=division_5, Expression="FORMAT(\"{0:R}\",O)")
panel_138 = Panel(expression_44)
scale_11 = Scale(Geometry=scale_10.Geometry, Center=Point(0, 0, 0), Factor=expr("1/X", panel_138))  # -> Geometry, Transform
scale_12 = Scale(Geometry=curve_52, Center=Point(0, 0, 0), Factor=expr("1/X", panel_138))  # -> Geometry, Transform
evaluate_length_11 = EvaluateLength(Curve=scale_12.Geometry, Length=1, Normalized=True)  # -> Point, Tangent, Parameter
deconstruct_6 = Deconstruct(Point=evaluate_length_11.Point)  # -> XComponent, YComponent, ZComponent
expression_45 = Expression(O=deconstruct_6.YComponent, Expression="FORMAT(\"{0:R}\",O)")
expression_46 = Expression(O=deconstruct_6.XComponent, Expression="FORMAT(\"{0:R}\",O)")
expression_47 = Expression(O=deconstruct_6.ZComponent, Expression="FORMAT(\"{0:R}\",O)")
panel_139 = Panel(expression_45)
panel_140 = Panel(expression_46)
panel_141 = Panel(expression_47)
division_6 = Division(A=panel_135, B=panel_134)
expression_48 = Expression(O=division_6, Expression="FORMAT(\"{0:R}\",O)")
panel_142 = Panel(expression_48)
curve_53 = Curve(scale_12.Geometry)
point_5 = Point(scale_11.Geometry)

move_4 = Move(Geometry=curve_53, Motion=Vector(2.5, 0, 0))  # -> Geometry, Transform; disabled
mirror_3 = Mirror(Geometry=curve_53, Plane=PlaneYZ(0, 0, 0))  # -> Geometry, Transform; disabled
curve_54 = Curve(move_4.Geometry)  # disabled

curve_55 = Curve(curve_53)
end_points_6 = EndPoints(Curve=curve_55)  # -> Start, End
rectangle_2pt_6 = Rectangle2Pt(Plane=PlaneXY(0, 0, 0), PointA=end_points_6.Start, PointB=end_points_6.End, Radius=0)  # -> Rectangle, Length
deconstuct_rectangle_2 = DeconstuctRectangle(Rectangle=rectangle_2pt_6.Rectangle)  # -> BasePlane, XInterval, YInterval
deconstruct_domain_3 = DeconstructDomain(Domain=deconstuct_rectangle_2.YInterval)  # -> Start, End
deconstruct_domain_4 = DeconstructDomain(Domain=deconstuct_rectangle_2.XInterval)  # -> Start, End
scale_nu_2 = ScaleNU(
    Geometry=curve_53,
    Plane=PlaneXY(0, 0, 0),
    ScaleX=expr("1/X", deconstruct_domain_4.End),
    ScaleY=expr("1/X", deconstruct_domain_3.End),
    ScaleZ=1)  # -> Geometry, Transform
curve_56 = Curve(scale_nu_2.Geometry)
move_5 = Move(Geometry=curve_56, Motion=Vector(2.5, 1.5, 0))  # -> Geometry, Transform
curve_57 = Curve(move_5.Geometry)

stream_filter_7 = StreamFilter(Gate=number_slider, Stream0=curve_53, Stream1=curve_56)
curve_58 = Curve(stream_filter_7)
scale_13 = Scale(Geometry=curve_58, Center=Point(0, 0, 0), Factor=expr("2^X", number_2))  # -> Geometry, Transform
curve_59 = Curve(scale_13.Geometry)

stream_filter_8 = StreamFilter(Gate=number_slider, Stream0=curve_53, Stream1=curve_56)
curve_60 = Curve(stream_filter_8)
scale_14 = Scale(Geometry=curve_60, Center=Point(0, 0, 0), Factor=expr("2^X", number_2))  # -> Geometry, Transform
curve_61 = Curve(scale_14.Geometry)

end_points_7 = EndPoints(Curve=curve_59)  # -> Start, End
rectangle_2pt_7 = Rectangle2Pt(Plane=PlaneXY(0, 0, 0), PointA=end_points_7.Start, PointB=end_points_7.End, Radius=0)  # -> Rectangle, Length

number_23 = Number(number_14)

series_5 = Series(Start=0, Step=panel_97, Count=number_23)
expression_49 = Expression(O=series_5, Expression="FORMAT(\"{0:R}\",O)")
panel_144 = Panel(expression_49)
bounds_3 = Bounds(Numbers=series_5)
expression_50 = Expression(X=number_23, O=number_6, Expression="X^O")
duplicate_data_4 = DuplicateData(Data=expression_50, Number=number_23, Order=True)

curve_graph_mapper_3 = CurveGraphMapper(Curves=curve_59, Rectangle=rectangle_2pt_7.Rectangle, Values=series_5, Flip=False, Snap=True, TextSize=0.015625)  # -> Mapped, GraphCurves, GraphPoints, ValueLines, ValuePoints, MappedLines, MappedPoints, Boundary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; disabled
graphmapper_3 = GraphMapper(Curve=curve_59, Boundary=rectangle_2pt_7.Rectangle, Numbers=series_5, Input=bounds_3, Output=bounds_3, bobo=False)
stream_filter_9 = StreamFilter(Gate=number_slider_2, Stream0=curve_graph_mapper_3.Mapped, Stream1=graphmapper_3)

turtle_4 = DotNETVBScriptLEGACY(Forward=duplicate_data_4, Left=stream_filter_9)  # -> Output, Points; inputs Forward: list, Left: list; same code as turtle

expression_51 = Expression(O=turtle_4.Points, Expression="FORMAT(\"{0:R}\",O)")
panel_145 = Panel(expression_51)

point_6 = Point(turtle_4.Points)
scale_15 = Scale(Geometry=point_6, Center=Point(0, 0, 0), Factor=expr("2^X", digit_scroller_60))  # -> Geometry, Transform

interpolate_t_4 = InterpolateT(Vertices=scale_15.Geometry, TangentStart=Vector(0.0625, 0, 0), TangentEnd=Vector(0, 0, 0), KnotStyle=2)  # -> Curve, Length, Domain
evaluate_length_12 = EvaluateLength(Curve=interpolate_t_4.Curve, Length=1, Normalized=True)  # -> Point, Tangent, Parameter
line_sdl_6 = LineSDL(Start=evaluate_length_12.Point, Direction=evaluate_length_12.Tangent, Length=1)
mirror_4 = Mirror(Geometry=interpolate_t_4.Curve, Plane=line_sdl_6)  # -> Geometry, Transform
join_curves_5 = JoinCurves(Curves=[interpolate_t_4.Curve, mirror_4.Geometry], Preserve=False)
evaluate_length_13 = EvaluateLength(Curve=join_curves_5, Length=1, Normalized=True)  # -> Point, Tangent, Parameter
rotate_4 = Rotate(Geometry=join_curves_5, Angle=3.141592654, Plane=evaluate_length_13.Point)  # -> Geometry, Transform
join_curves_6 = JoinCurves(Curves=[join_curves_5, rotate_4.Geometry], Preserve=False)
curve_62 = Curve(join_curves_6)

evaluate_length_14 = EvaluateLength(Curve=join_curves_6, Length=1, Normalized=True)  # -> Point, Tangent, Parameter
deconstruct_7 = Deconstruct(Point=evaluate_length_14.Point)  # -> XComponent, YComponent, ZComponent
expression_52 = Expression(O=deconstruct_7.YComponent, Expression="FORMAT(\"{0:R}\",O)")
expression_53 = Expression(O=deconstruct_7.XComponent, Expression="FORMAT(\"{0:R}\",O)")
expression_54 = Expression(O=deconstruct_7.ZComponent, Expression="FORMAT(\"{0:R}\",O)")
panel_146 = Panel(expression_52)
panel_147 = Panel(expression_53)
panel_148 = Panel(expression_54)
addition_5 = Addition(A=panel_146, B=panel_147)
expression_55 = Expression(O=addition_5, Expression="FORMAT(\"{0:R}\",O)")
panel_149 = Panel(expression_55)
division_7 = Division(A=panel_149, B=2)
expression_56 = Expression(O=division_7, Expression="FORMAT(\"{0:R}\",O)")
panel_150 = Panel(expression_56)
scale_16 = Scale(Geometry=scale_15.Geometry, Center=Point(0, 0, 0), Factor=expr("1/X", panel_150))  # -> Geometry, Transform
scale_17 = Scale(Geometry=curve_62, Center=Point(0, 0, 0), Factor=expr("1/X", panel_150))  # -> Geometry, Transform
evaluate_length_15 = EvaluateLength(Curve=scale_17.Geometry, Length=1, Normalized=True)  # -> Point, Tangent, Parameter
deconstruct_8 = Deconstruct(Point=evaluate_length_15.Point)  # -> XComponent, YComponent, ZComponent
expression_57 = Expression(O=deconstruct_8.YComponent, Expression="FORMAT(\"{0:R}\",O)")
expression_58 = Expression(O=deconstruct_8.XComponent, Expression="FORMAT(\"{0:R}\",O)")
expression_59 = Expression(O=deconstruct_8.ZComponent, Expression="FORMAT(\"{0:R}\",O)")
panel_151 = Panel(expression_57)
panel_152 = Panel(expression_58)
panel_153 = Panel(expression_59)
division_8 = Division(A=panel_147, B=panel_146)
expression_60 = Expression(O=division_8, Expression="FORMAT(\"{0:R}\",O)")
panel_154 = Panel(expression_60)
curve_63 = Curve(scale_17.Geometry)
point_7 = Point(scale_16.Geometry)

move_6 = Move(Geometry=curve_63, Motion=vector_xyz_2.Vector)  # -> Geometry, Transform
mirror_5 = Mirror(Geometry=curve_63, Plane=PlaneYZ(0, 0, 0))  # -> Geometry, Transform
curve_64 = Curve(move_6.Geometry)

end_points_8 = EndPoints(Curve=curve_61)  # -> Start, End
rectangle_2pt_8 = Rectangle2Pt(Plane=PlaneXY(0, 0, 0), PointA=end_points_8.Start, PointB=end_points_8.End, Radius=0)  # -> Rectangle, Length

number_24 = Number(number_14)

series_6 = Series(Start=0, Step=panel_67, Count=number_24)

reverse_list_3 = ReverseList(List=series_6)
expression_61 = Expression(X=number_24, O=number_7, Expression="(X-1)^O")

list_length_5 = ListLength(List=reverse_list_3)
construct_domain_5 = ConstructDomain(DomainStart="0", DomainEnd=expr("X-2", list_length_5))
range_5 = Range(Domain=construct_domain_5, Steps=expr("X-2", list_length_5))
list_item_5 = ListItem(List=reverse_list_3, Index=range_5, Wrap=False)
panel_157 = Panel(list_item_5)

expression_62 = Expression(O=list_item_5, Expression="FORMAT(\"{0:R}\",O)")
panel_158 = Panel(expression_62)
bounds_4 = Bounds(Numbers=list_item_5)

curve_graph_mapper_4 = CurveGraphMapper(Curves=curve_61, Rectangle=rectangle_2pt_8.Rectangle, Values=list_item_5, Flip=False, Snap=True, TextSize=0.015625)  # -> Mapped, GraphCurves, GraphPoints, ValueLines, ValuePoints, MappedLines, MappedPoints, Boundary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; disabled
duplicate_data_5 = DuplicateData(Data=expression_61, Number=expr("X-1", number_24), Order=True)
graphmapper_4 = GraphMapper(Curve=curve_61, Boundary=rectangle_2pt_8.Rectangle, Numbers=list_item_5, Input=bounds_4, Output=bounds_4, bobo=True)
stream_filter_10 = StreamFilter(Gate=number_slider_2, Stream0=curve_graph_mapper_4.Mapped, Stream1=graphmapper_4)

list_length_6 = ListLength(List=duplicate_data_5)
construct_domain_6 = ConstructDomain(DomainStart="0", DomainEnd=expr("X-2", list_length_6))
range_6 = Range(Domain=construct_domain_6, Steps=expr("X-2", list_length_6))
list_item_6 = ListItem(List=duplicate_data_5, Index=range_6, Wrap=False)
panel_159 = Panel(list_item_6)

turtle_5 = DotNETVBScriptLEGACY(Forward=list_item_6, Left=stream_filter_10)  # -> Output, Points; inputs Forward: list, Left: list; same code as turtle
expression_63 = Expression(O=turtle_5.Points, Expression="FORMAT(\"{0:R}\",O)")
panel_160 = Panel(expression_63)

point_8 = Point(turtle_5.Points)
scale_18 = Scale(Geometry=point_8, Center=Point(0, 0, 0), Factor=expr("2^X", digit_scroller_63))  # -> Geometry, Transform

interpolate_t_5 = InterpolateT(Vertices=scale_18.Geometry, TangentStart=Vector(0.0625, 0, 0), TangentEnd=Vector(0, 0, 0), KnotStyle=2)  # -> Curve, Length, Domain
evaluate_length_16 = EvaluateLength(Curve=interpolate_t_5.Curve, Length=1, Normalized=True)  # -> Point, Tangent, Parameter
rotate_5 = Rotate(Geometry=interpolate_t_5.Curve, Angle=3.141592654, Plane=evaluate_length_16.Point)  # -> Geometry, Transform
join_curves_7 = JoinCurves(Curves=[interpolate_t_5.Curve, rotate_5.Geometry], Preserve=False)
curve_65 = Curve(join_curves_7)

evaluate_length_17 = EvaluateLength(Curve=join_curves_7, Length=1, Normalized=True)  # -> Point, Tangent, Parameter
deconstruct_9 = Deconstruct(Point=evaluate_length_17.Point)  # -> XComponent, YComponent, ZComponent
expression_64 = Expression(O=deconstruct_9.YComponent, Expression="FORMAT(\"{0:R}\",O)")
expression_65 = Expression(O=deconstruct_9.XComponent, Expression="FORMAT(\"{0:R}\",O)")
expression_66 = Expression(O=deconstruct_9.ZComponent, Expression="FORMAT(\"{0:R}\",O)")
panel_161 = Panel(expression_64)
panel_162 = Panel(expression_65)
panel_163 = Panel(expression_66)
addition_6 = Addition(A=panel_161, B=panel_162)
expression_67 = Expression(O=addition_6, Expression="FORMAT(\"{0:R}\",O)")
panel_164 = Panel(expression_67)
division_9 = Division(A=panel_164, B=2)
expression_68 = Expression(O=division_9, Expression="FORMAT(\"{0:R}\",O)")
panel_165 = Panel(expression_68)
scale_19 = Scale(Geometry=scale_18.Geometry, Center=Point(0, 0, 0), Factor=expr("1/X", panel_165))  # -> Geometry, Transform
scale_20 = Scale(Geometry=curve_65, Center=Point(0, 0, 0), Factor=expr("1/X", panel_165))  # -> Geometry, Transform
evaluate_length_18 = EvaluateLength(Curve=scale_20.Geometry, Length=1, Normalized=True)  # -> Point, Tangent, Parameter
deconstruct_10 = Deconstruct(Point=evaluate_length_18.Point)  # -> XComponent, YComponent, ZComponent
expression_69 = Expression(O=deconstruct_10.YComponent, Expression="FORMAT(\"{0:R}\",O)")
expression_70 = Expression(O=deconstruct_10.XComponent, Expression="FORMAT(\"{0:R}\",O)")
expression_71 = Expression(O=deconstruct_10.ZComponent, Expression="FORMAT(\"{0:R}\",O)")
panel_166 = Panel(expression_69)
panel_167 = Panel(expression_70)
panel_168 = Panel(expression_71)
division_10 = Division(A=panel_162, B=panel_161)
expression_72 = Expression(O=division_10, Expression="FORMAT(\"{0:R}\",O)")
panel_169 = Panel(expression_72)
curve_66 = Curve(scale_20.Geometry)
point_9 = Point(scale_19.Geometry)

move_7 = Move(Geometry=curve_66, Motion=Vector(2.5, 0, 0))  # -> Geometry, Transform; disabled
mirror_6 = Mirror(Geometry=curve_66, Plane=PlaneYZ(0, 0, 0))  # -> Geometry, Transform; disabled
curve_67 = Curve(move_7.Geometry)  # disabled

curve_68 = Curve(curve_66)
end_points_9 = EndPoints(Curve=curve_68)  # -> Start, End
rectangle_2pt_9 = Rectangle2Pt(Plane=PlaneXY(0, 0, 0), PointA=end_points_9.Start, PointB=end_points_9.End, Radius=0)  # -> Rectangle, Length
deconstuct_rectangle_3 = DeconstuctRectangle(Rectangle=rectangle_2pt_9.Rectangle)  # -> BasePlane, XInterval, YInterval
deconstruct_domain_5 = DeconstructDomain(Domain=deconstuct_rectangle_3.YInterval)  # -> Start, End
deconstruct_domain_6 = DeconstructDomain(Domain=deconstuct_rectangle_3.XInterval)  # -> Start, End
scale_nu_3 = ScaleNU(
    Geometry=curve_66,
    Plane=PlaneXY(0, 0, 0),
    ScaleX=expr("1/X", deconstruct_domain_6.End),
    ScaleY=expr("1/X", deconstruct_domain_5.End),
    ScaleZ=1)  # -> Geometry, Transform
curve_69 = Curve(scale_nu_3.Geometry)
move_8 = Move(Geometry=curve_69, Motion=Vector(2.5, 1.5, 0))  # -> Geometry, Transform
curve_70 = Curve(move_8.Geometry)

curve_71 = Curve(curve_69)

stream_filter_11 = StreamFilter(Gate=number_slider, Stream0=curve_66, Stream1=curve_69)
curve_72 = Curve(stream_filter_11)
scale_21 = Scale(Geometry=curve_72, Center=Point(0, 0, 0), Factor=expr("2^X", number_2))  # -> Geometry, Transform
curve_73 = Curve(scale_21.Geometry)

end_points_10 = EndPoints(Curve=curve_73)  # -> Start, End
rectangle_2pt_10 = Rectangle2Pt(Plane=PlaneXY(0, 0, 0), PointA=end_points_10.Start, PointB=end_points_10.End, Radius=0)  # -> Rectangle, Length

number_25 = Number(number_14)

series_7 = Series(Start=0, Step=panel_72, Count=number_25)

reverse_list_4 = ReverseList(List=series_7)
expression_73 = Expression(X=number_25, O=number_8, Expression="(X-1)^O")

list_length_7 = ListLength(List=reverse_list_4)
construct_domain_7 = ConstructDomain(DomainStart="0", DomainEnd=expr("X-2", list_length_7))
range_7 = Range(Domain=construct_domain_7, Steps=expr("X-2", list_length_7))
list_item_7 = ListItem(List=reverse_list_4, Index=range_7, Wrap=False)
panel_171 = Panel(list_item_7)

expression_74 = Expression(O=list_item_7, Expression="FORMAT(\"{0:R}\",O)")
panel_172 = Panel(expression_74)
bounds_5 = Bounds(Numbers=list_item_7)

curve_graph_mapper_5 = CurveGraphMapper(Curves=curve_73, Rectangle=rectangle_2pt_10.Rectangle, Values=list_item_7, Flip=False, Snap=True, TextSize=0.015625)  # -> Mapped, GraphCurves, GraphPoints, ValueLines, ValuePoints, MappedLines, MappedPoints, Boundary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; disabled
duplicate_data_6 = DuplicateData(Data=expression_73, Number=expr("X-1", number_25), Order=True)
graphmapper_5 = GraphMapper(Curve=curve_73, Boundary=rectangle_2pt_10.Rectangle, Numbers=list_item_7, Input=bounds_5, Output=bounds_5, bobo=True)
stream_filter_12 = StreamFilter(Gate=number_slider_2, Stream0=curve_graph_mapper_5.Mapped, Stream1=graphmapper_5)

list_length_8 = ListLength(List=duplicate_data_6)
construct_domain_8 = ConstructDomain(DomainStart="0", DomainEnd=expr("X-2", list_length_8))
range_8 = Range(Domain=construct_domain_8, Steps=expr("X-2", list_length_8))
list_item_8 = ListItem(List=duplicate_data_6, Index=range_8, Wrap=False)
panel_173 = Panel(list_item_8)

turtle_6 = DotNETVBScriptLEGACY(Forward=list_item_8, Left=stream_filter_12)  # -> Output, Points; inputs Forward: list, Left: list; same code as turtle
expression_75 = Expression(O=turtle_6.Points, Expression="FORMAT(\"{0:R}\",O)")
panel_174 = Panel(expression_75)

point_10 = Point(turtle_6.Points)
scale_22 = Scale(Geometry=point_10, Center=Point(0, 0, 0), Factor=expr("2^X", digit_scroller_66))  # -> Geometry, Transform

interpolate_t_6 = InterpolateT(Vertices=scale_22.Geometry, TangentStart=Vector(0.0625, 0, 0), TangentEnd=Vector(0, 0, 0), KnotStyle=2)  # -> Curve, Length, Domain
evaluate_length_19 = EvaluateLength(Curve=interpolate_t_6.Curve, Length=1, Normalized=True)  # -> Point, Tangent, Parameter
rotate_6 = Rotate(Geometry=interpolate_t_6.Curve, Angle=3.141592654, Plane=evaluate_length_19.Point)  # -> Geometry, Transform
join_curves_8 = JoinCurves(Curves=[interpolate_t_6.Curve, rotate_6.Geometry], Preserve=False)
curve_74 = Curve(join_curves_8)

evaluate_length_20 = EvaluateLength(Curve=join_curves_8, Length=1, Normalized=True)  # -> Point, Tangent, Parameter
deconstruct_11 = Deconstruct(Point=evaluate_length_20.Point)  # -> XComponent, YComponent, ZComponent
expression_76 = Expression(O=deconstruct_11.YComponent, Expression="FORMAT(\"{0:R}\",O)")
expression_77 = Expression(O=deconstruct_11.XComponent, Expression="FORMAT(\"{0:R}\",O)")
expression_78 = Expression(O=deconstruct_11.ZComponent, Expression="FORMAT(\"{0:R}\",O)")
panel_175 = Panel(expression_76)
panel_176 = Panel(expression_77)
panel_177 = Panel(expression_78)
addition_7 = Addition(A=panel_175, B=panel_176)
expression_79 = Expression(O=addition_7, Expression="FORMAT(\"{0:R}\",O)")
panel_178 = Panel(expression_79)
division_11 = Division(A=panel_178, B=2)
expression_80 = Expression(O=division_11, Expression="FORMAT(\"{0:R}\",O)")
panel_179 = Panel(expression_80)
scale_23 = Scale(Geometry=scale_22.Geometry, Center=Point(0, 0, 0), Factor=expr("1/X", panel_179))  # -> Geometry, Transform
scale_24 = Scale(Geometry=curve_74, Center=Point(0, 0, 0), Factor=expr("1/X", panel_179))  # -> Geometry, Transform
evaluate_length_21 = EvaluateLength(Curve=scale_24.Geometry, Length=1, Normalized=True)  # -> Point, Tangent, Parameter
deconstruct_12 = Deconstruct(Point=evaluate_length_21.Point)  # -> XComponent, YComponent, ZComponent
expression_81 = Expression(O=deconstruct_12.YComponent, Expression="FORMAT(\"{0:R}\",O)")
expression_82 = Expression(O=deconstruct_12.XComponent, Expression="FORMAT(\"{0:R}\",O)")
expression_83 = Expression(O=deconstruct_12.ZComponent, Expression="FORMAT(\"{0:R}\",O)")
panel_180 = Panel(expression_81)
panel_181 = Panel(expression_82)
panel_182 = Panel(expression_83)
division_12 = Division(A=panel_176, B=panel_175)
expression_84 = Expression(O=division_12, Expression="FORMAT(\"{0:R}\",O)")
panel_183 = Panel(expression_84)
curve_75 = Curve(scale_24.Geometry)
point_11 = Point(scale_23.Geometry)

move_9 = Move(Geometry=curve_75, Motion=Vector(2.5, 0, 0))  # -> Geometry, Transform; disabled
mirror_7 = Mirror(Geometry=curve_75, Plane=PlaneYZ(0, 0, 0))  # -> Geometry, Transform; disabled
curve_76 = Curve(move_9.Geometry)  # disabled

curve_77 = Curve(curve_75)
end_points_11 = EndPoints(Curve=curve_77)  # -> Start, End
rectangle_2pt_11 = Rectangle2Pt(Plane=PlaneXY(0, 0, 0), PointA=end_points_11.Start, PointB=end_points_11.End, Radius=0)  # -> Rectangle, Length
deconstuct_rectangle_4 = DeconstuctRectangle(Rectangle=rectangle_2pt_11.Rectangle)  # -> BasePlane, XInterval, YInterval
deconstruct_domain_7 = DeconstructDomain(Domain=deconstuct_rectangle_4.YInterval)  # -> Start, End
deconstruct_domain_8 = DeconstructDomain(Domain=deconstuct_rectangle_4.XInterval)  # -> Start, End
scale_nu_4 = ScaleNU(
    Geometry=curve_75,
    Plane=PlaneXY(0, 0, 0),
    ScaleX=expr("1/X", deconstruct_domain_8.End),
    ScaleY=expr("1/X", deconstruct_domain_7.End),
    ScaleZ=1)  # -> Geometry, Transform
curve_78 = Curve(scale_nu_4.Geometry)
move_10 = Move(Geometry=curve_78, Motion=Vector(2.5, 1.5, 0))  # -> Geometry, Transform
curve_79 = Curve(move_10.Geometry)

curve_80 = Curve(curve_78)
curve_81 = Curve(curve_78)
bounding_box = BoundingBox(Content=curve_78, Plane=PlaneXY(0, 0, 0), UnionBox=True)  # -> Box, Box_2
curve_82 = Curve(curve_78)

curve_83 = Curve(curve_82)

curve_84 = Curve(graft(curve_83))

evaluate_length_22 = EvaluateLength(Curve=curve_84, Length=1, Normalized=True)  # -> Point, Tangent, Parameter; disabled
deconstruct_13 = Deconstruct(Point=evaluate_length_22.Point)  # -> XComponent, YComponent, ZComponent; disabled
scale_nu_5 = ScaleNU(
    Geometry=curve_84,
    Plane=PlaneXY(0, 0, 0),
    ScaleX=expr("1/X", deconstruct_13.XComponent),
    ScaleY=expr("1/X", deconstruct_13.YComponent),
    ScaleZ=1)  # -> Geometry, Transform; disabled

curve_85 = Curve(graft(curve_84))
length = Length(Curve=curve_85)
custom_preview_3 = CustomPreview(Geometry=curve_85, Material=create_material_23)
curvature_graph = CurvatureGraph(Curve=curve_85, Density=1, Scale=digit_scroller_72)  # disabled
number_26 = Number(number_20)
divide_curve_2 = DivideCurve(Curve=curve_85, Count=number_26, Kinks=False)  # -> Points, Tangents, Parameters
curvature = Curvature(Curve=curve_85, Parameter=divide_curve_2.Parameters)  # -> Point, Curvature, Curvature_2
deconstruct_arc = DeconstructArc(Arc=curvature.Curvature_2)  # -> BasePlane, Radius, Angle
line = Line(StartPoint=curvature.Point, EndPoint=deconstruct_arc.BasePlane)
one_over_x = OneOverX(Value=deconstruct_arc.Radius)
expression_85 = Expression(O=one_over_x, Expression="FORMAT(\"{0:R}\",O)")  # disabled
panel_185 = Panel(expression_85)
quick_graph_9 = QuickGraph(one_over_x, SortOrder=0)
bounds_6 = Bounds(Numbers=one_over_x)
remap_numbers = RemapNumbers(Value=one_over_x, Source=bounds_6, Target=Domain(0, 1))  # -> Mapped, Clipped
multiplication_2 = Multiplication(A=length, B=remap_numbers.Mapped)
multiplication_3 = Multiplication(A=multiplication_2, B=digit_scroller_73)
line_sdl_7 = LineSDL(Start=curvature.Point, Direction=curvature.Curvature, Length=expr("-X", multiplication_3))
evaluate_length_23 = EvaluateLength(Curve=line_sdl_7, Length=1, Normalized=True)  # -> Point, Tangent, Parameter
interpolate_3 = Interpolate(Vertices=evaluate_length_23.Point, Degree=1, Periodic=False, KnotStyle=2)  # -> Curve, Length, Domain
custom_preview_4 = CustomPreview(Geometry=line_sdl_7, Material=create_material_22)
number_27 = Number(number_26)
curve_86 = Curve(interpolate_3.Curve)
custom_preview_5 = CustomPreview(Geometry=curve_86, Material=create_material_21)

expression_86 = Expression(O=deconstruct_arc.Radius, Expression="FORMAT(\"{0:R}\",O)")  # disabled
panel_186 = Panel(expression_86)

replace_nulls = ReplaceNulls(Items=one_over_x, Replacements=0)  # -> Items, Count
relative_differences = RelativeDifferences(Values=replace_nulls.Items)
list_length_9 = ListLength(List=relative_differences)
series_8 = Series(Start=1, Step=1, Count=expr("X-1", list_length_9))
list_item_9 = ListItem(List=relative_differences, Index=series_8, Wrap=False)

expression_87 = Expression(O=list_item_9, Expression="FORMAT(\"{0:R}\",O)")  # disabled
panel_187 = Panel(expression_87)

replace_nulls_2 = ReplaceNulls(Items=list_item_9, Replacements=0)  # -> Items, Count
relative_differences_2 = RelativeDifferences(Values=replace_nulls_2.Items)
list_length_10 = ListLength(List=relative_differences_2)
series_9 = Series(Start=1, Step=1, Count=expr("X-1", list_length_10))
list_item_10 = ListItem(List=relative_differences_2, Index=series_9, Wrap=False)

expression_88 = Expression(O=list_item_10, Expression="FORMAT(\"{0:R}\",O)")  # disabled
panel_188 = Panel(expression_88)

replace_nulls_3 = ReplaceNulls(Items=list_item_10, Replacements=0)  # -> Items, Count
relative_differences_3 = RelativeDifferences(Values=replace_nulls_3.Items)
list_length_11 = ListLength(List=relative_differences_3)
series_10 = Series(Start=1, Step=1, Count=expr("X-1", list_length_11))
list_item_11 = ListItem(List=relative_differences_3, Index=series_10, Wrap=False)

expression_89 = Expression(O=list_item_11, Expression="FORMAT(\"{0:R}\",O)")  # disabled
panel_189 = Panel(expression_89)

replace_nulls_4 = ReplaceNulls(Items=list_item_11, Replacements=0)  # -> Items, Count
relative_differences_4 = RelativeDifferences(Values=replace_nulls_4.Items)
list_length_12 = ListLength(List=relative_differences_4)
series_11 = Series(Start=1, Step=1, Count=expr("X-1", list_length_12))
list_item_12 = ListItem(List=relative_differences_4, Index=series_11, Wrap=False)

expression_90 = Expression(O=list_item_12, Expression="FORMAT(\"{0:R}\",O)")  # disabled
panel_190 = Panel(expression_90)

replace_nulls_5 = ReplaceNulls(Items=list_item_12, Replacements=0)  # -> Items, Count
relative_differences_5 = RelativeDifferences(Values=replace_nulls_5.Items)
list_length_13 = ListLength(List=relative_differences_5)
series_12 = Series(Start=1, Step=1, Count=expr("X-1", list_length_13))
list_item_13 = ListItem(List=relative_differences_5, Index=series_12, Wrap=False)

expression_91 = Expression(O=list_item_13, Expression="FORMAT(\"{0:R}\",O)")  # disabled
panel_191 = Panel(expression_91)

replace_nulls_6 = ReplaceNulls(Items=list_item_13, Replacements=0)  # -> Items, Count
relative_differences_6 = RelativeDifferences(Values=replace_nulls_6.Items)
list_length_14 = ListLength(List=relative_differences_6)
series_13 = Series(Start=1, Step=1, Count=expr("X-1", list_length_14))
list_item_14 = ListItem(List=relative_differences_6, Index=series_13, Wrap=False)

expression_92 = Expression(O=list_item_14, Expression="FORMAT(\"{0:R}\",O)")  # disabled
panel_192 = Panel(expression_92)

replace_nulls_7 = ReplaceNulls(Items=list_item_14, Replacements=0)  # -> Items, Count
relative_differences_7 = RelativeDifferences(Values=replace_nulls_7.Items)
list_length_15 = ListLength(List=relative_differences_7)
series_14 = Series(Start=1, Step=1, Count=expr("X-1", list_length_15))
list_item_15 = ListItem(List=relative_differences_7, Index=series_14, Wrap=False)

expression_93 = Expression(O=list_item_15, Expression="FORMAT(\"{0:R}\",O)")  # disabled
panel_193 = Panel(expression_93)

explode = Explode(Curve=curve_86, Recursive=True)  # -> Segments, Vertices
evaluate_length_24 = EvaluateLength(Curve=explode.Segments, Length=0.5, Normalized=True)  # -> Point, Tangent, Parameter
curve_closest_point = CurveClosestPoint(Point=evaluate_length_24.Point, Curve=curve_85)  # -> Point, Parameter, Distance
line_2 = Line(StartPoint=curve_closest_point.Point, EndPoint=evaluate_length_24.Point)

bounds_7 = Bounds(Numbers=list_item_15)
remap_numbers_2 = RemapNumbers(Value=list_item_15, Source=bounds_7, Target=Domain(-1, 1))  # -> Mapped, Clipped
multiplication_4 = Multiplication(A=length, B=remap_numbers_2.Mapped)
multiplication_5 = Multiplication(A=multiplication_4, B=digit_scroller_74)

bounds_8 = Bounds(Numbers=list_item_14)
remap_numbers_3 = RemapNumbers(Value=list_item_14, Source=bounds_8, Target=Domain(-1, 1))  # -> Mapped, Clipped
multiplication_6 = Multiplication(A=length, B=remap_numbers_3.Mapped)
multiplication_7 = Multiplication(A=multiplication_6, B=digit_scroller_69)

bounds_9 = Bounds(Numbers=list_item_13)
remap_numbers_4 = RemapNumbers(Value=list_item_13, Source=bounds_9, Target=Domain(-1, 1))  # -> Mapped, Clipped
multiplication_8 = Multiplication(A=length, B=remap_numbers_4.Mapped)
multiplication_9 = Multiplication(A=multiplication_8, B=digit_scroller_75)

bounds_10 = Bounds(Numbers=list_item_12)
remap_numbers_5 = RemapNumbers(Value=list_item_12, Source=bounds_10, Target=Domain(-1, 1))  # -> Mapped, Clipped
multiplication_10 = Multiplication(A=length, B=remap_numbers_5.Mapped)
multiplication_11 = Multiplication(A=multiplication_10, B=digit_scroller_70)

bounds_11 = Bounds(Numbers=list_item_11)
remap_numbers_6 = RemapNumbers(Value=list_item_11, Source=bounds_11, Target=Domain(-1, 1))  # -> Mapped, Clipped
multiplication_12 = Multiplication(A=length, B=remap_numbers_6.Mapped)
multiplication_13 = Multiplication(A=multiplication_12, B=digit_scroller_76)

bounds_12 = Bounds(Numbers=list_item_10)
remap_numbers_7 = RemapNumbers(Value=list_item_10, Source=bounds_12, Target=Domain(-1, 1))  # -> Mapped, Clipped
multiplication_14 = Multiplication(A=length, B=remap_numbers_7.Mapped)
multiplication_15 = Multiplication(A=multiplication_14, B=digit_scroller_77)

bounds_13 = Bounds(Numbers=list_item_9)
remap_numbers_8 = RemapNumbers(Value=list_item_9, Source=bounds_13, Target=Domain(-1, 1))  # -> Mapped, Clipped
multiplication_16 = Multiplication(A=length, B=remap_numbers_8.Mapped)
multiplication_17 = Multiplication(A=multiplication_16, B=digit_scroller_78)

quick_graph_10 = QuickGraph(list_item_9, SortOrder=0)
line_sdl_8 = LineSDL(Start=evaluate_length_24.Point, Direction=line_2, Length=expr("ABS(X)", multiplication_17))
evaluate_length_25 = EvaluateLength(Curve=line_sdl_8, Length=1, Normalized=True)  # -> Point, Tangent, Parameter
interpolate_4 = Interpolate(Vertices=evaluate_length_25.Point, Degree=1, Periodic=False, KnotStyle=2)  # -> Curve, Length, Domain
custom_preview_6 = CustomPreview(Geometry=interpolate_4.Curve, Material=create_material_36)
custom_preview_7 = CustomPreview(Geometry=line_sdl_8, Material=create_material_37)

explode_2 = Explode(Curve=interpolate_4.Curve, Recursive=True)  # -> Segments, Vertices
evaluate_length_26 = EvaluateLength(Curve=explode_2.Segments, Length=0.5, Normalized=True)  # -> Point, Tangent, Parameter
curve_closest_point_2 = CurveClosestPoint(Point=evaluate_length_26.Point, Curve=curve_85)  # -> Point, Parameter, Distance
line_3 = Line(StartPoint=curve_closest_point_2.Point, EndPoint=evaluate_length_26.Point)

quick_graph_11 = QuickGraph(list_item_10, SortOrder=0)
line_sdl_9 = LineSDL(Start=evaluate_length_26.Point, Direction=line_3, Length=expr("ABS(X)", multiplication_15))
evaluate_length_27 = EvaluateLength(Curve=line_sdl_9, Length=1, Normalized=True)  # -> Point, Tangent, Parameter
interpolate_5 = Interpolate(Vertices=evaluate_length_27.Point, Degree=1, Periodic=False, KnotStyle=2)  # -> Curve, Length, Domain
custom_preview_8 = CustomPreview(Geometry=interpolate_5.Curve, Material=create_material_34)
custom_preview_9 = CustomPreview(Geometry=line_sdl_9, Material=create_material_35)

explode_3 = Explode(Curve=interpolate_5.Curve, Recursive=True)  # -> Segments, Vertices
evaluate_length_28 = EvaluateLength(Curve=explode_3.Segments, Length=0.5, Normalized=True)  # -> Point, Tangent, Parameter
curve_closest_point_3 = CurveClosestPoint(Point=evaluate_length_28.Point, Curve=curve_85)  # -> Point, Parameter, Distance
line_4 = Line(StartPoint=curve_closest_point_3.Point, EndPoint=evaluate_length_28.Point)

quick_graph_12 = QuickGraph(list_item_11, SortOrder=0)
line_sdl_10 = LineSDL(Start=evaluate_length_28.Point, Direction=line_4, Length=expr("ABS(X)", multiplication_13))
evaluate_length_29 = EvaluateLength(Curve=line_sdl_10, Length=1, Normalized=True)  # -> Point, Tangent, Parameter
interpolate_6 = Interpolate(Vertices=evaluate_length_29.Point, Degree=1, Periodic=False, KnotStyle=2)  # -> Curve, Length, Domain
custom_preview_10 = CustomPreview(Geometry=interpolate_6.Curve, Material=create_material_32)
custom_preview_11 = CustomPreview(Geometry=line_sdl_10, Material=create_material_33)

explode_4 = Explode(Curve=interpolate_6.Curve, Recursive=True)  # -> Segments, Vertices
evaluate_length_30 = EvaluateLength(Curve=explode_4.Segments, Length=0.5, Normalized=True)  # -> Point, Tangent, Parameter
curve_closest_point_4 = CurveClosestPoint(Point=evaluate_length_30.Point, Curve=curve_85)  # -> Point, Parameter, Distance
line_5 = Line(StartPoint=curve_closest_point_4.Point, EndPoint=evaluate_length_30.Point)

quick_graph_13 = QuickGraph(list_item_12, SortOrder=0)
line_sdl_11 = LineSDL(Start=evaluate_length_30.Point, Direction=line_5, Length=expr("ABS(X)", multiplication_11))
evaluate_length_31 = EvaluateLength(Curve=line_sdl_11, Length=1, Normalized=True)  # -> Point, Tangent, Parameter
interpolate_7 = Interpolate(Vertices=evaluate_length_31.Point, Degree=1, Periodic=False, KnotStyle=2)  # -> Curve, Length, Domain
custom_preview_12 = CustomPreview(Geometry=interpolate_7.Curve, Material=create_material_30)
custom_preview_13 = CustomPreview(Geometry=line_sdl_11, Material=create_material_31)

explode_5 = Explode(Curve=interpolate_7.Curve, Recursive=True)  # -> Segments, Vertices
evaluate_length_32 = EvaluateLength(Curve=explode_5.Segments, Length=0.5, Normalized=True)  # -> Point, Tangent, Parameter
curve_closest_point_5 = CurveClosestPoint(Point=evaluate_length_32.Point, Curve=curve_85)  # -> Point, Parameter, Distance
line_6 = Line(StartPoint=curve_closest_point_5.Point, EndPoint=evaluate_length_32.Point)

quick_graph_14 = QuickGraph(list_item_13, SortOrder=0)
line_sdl_12 = LineSDL(Start=evaluate_length_32.Point, Direction=line_6, Length=expr("ABS(X)", multiplication_9))
evaluate_length_33 = EvaluateLength(Curve=line_sdl_12, Length=1, Normalized=True)  # -> Point, Tangent, Parameter
interpolate_8 = Interpolate(Vertices=evaluate_length_33.Point, Degree=1, Periodic=False, KnotStyle=2)  # -> Curve, Length, Domain
custom_preview_14 = CustomPreview(Geometry=interpolate_8.Curve, Material=create_material_28)
custom_preview_15 = CustomPreview(Geometry=line_sdl_12, Material=create_material_29)

explode_6 = Explode(Curve=interpolate_8.Curve, Recursive=True)  # -> Segments, Vertices
evaluate_length_34 = EvaluateLength(Curve=explode_6.Segments, Length=0.5, Normalized=True)  # -> Point, Tangent, Parameter
curve_closest_point_6 = CurveClosestPoint(Point=evaluate_length_34.Point, Curve=curve_85)  # -> Point, Parameter, Distance
line_7 = Line(StartPoint=curve_closest_point_6.Point, EndPoint=evaluate_length_34.Point)

quick_graph_15 = QuickGraph(list_item_14, SortOrder=0)
line_sdl_13 = LineSDL(Start=evaluate_length_34.Point, Direction=line_7, Length=expr("ABS(X)", multiplication_7))
evaluate_length_35 = EvaluateLength(Curve=line_sdl_13, Length=1, Normalized=True)  # -> Point, Tangent, Parameter
interpolate_9 = Interpolate(Vertices=evaluate_length_35.Point, Degree=1, Periodic=False, KnotStyle=2)  # -> Curve, Length, Domain
custom_preview_16 = CustomPreview(Geometry=interpolate_9.Curve, Material=create_material_26)
custom_preview_17 = CustomPreview(Geometry=line_sdl_13, Material=create_material_27)

explode_7 = Explode(Curve=interpolate_9.Curve, Recursive=True)  # -> Segments, Vertices
evaluate_length_36 = EvaluateLength(Curve=explode_7.Segments, Length=0.5, Normalized=True)  # -> Point, Tangent, Parameter
curve_closest_point_7 = CurveClosestPoint(Point=evaluate_length_36.Point, Curve=curve_85)  # -> Point, Parameter, Distance
line_8 = Line(StartPoint=curve_closest_point_7.Point, EndPoint=evaluate_length_36.Point)

quick_graph_16 = QuickGraph(list_item_15, SortOrder=0)
line_sdl_14 = LineSDL(Start=evaluate_length_36.Point, Direction=line_8, Length=expr("ABS(X)", multiplication_5))
evaluate_length_37 = EvaluateLength(Curve=line_sdl_14, Length=1, Normalized=True)  # -> Point, Tangent, Parameter
interpolate_10 = Interpolate(Vertices=evaluate_length_37.Point, Degree=1, Periodic=False, KnotStyle=2)  # -> Curve, Length, Domain
custom_preview_18 = CustomPreview(Geometry=interpolate_10.Curve, Material=create_material_24)
custom_preview_19 = CustomPreview(Geometry=line_sdl_14, Material=create_material_25)

curve_87 = Curve(curve_85)  # disabled
number_28 = Number(number_26)  # disabled
divide_curve_3 = DivideCurve(Curve=curve_87, Count=number_28, Kinks=False)  # -> Points, Tangents, Parameters; disabled
deconstruct_14 = Deconstruct(Point=divide_curve_3.Points)  # -> graft(XComponent), graft(YComponent), ZComponent; disabled
expression_94 = Expression(X=deconstruct_14.XComponent, Expression="FORMAT(\"{0:R}\",ROUND(X, 15))")  # -> simplify(Result); disabled
expression_95 = Expression(Y=deconstruct_14.YComponent, Expression="FORMAT(\"{0:R}\",ROUND(Y, 15))")  # -> simplify(Result); disabled
expression_96 = Expression(Y=deconstruct_14.YComponent, Expression="FORMAT(\"{0:R}\",Y)")  # -> simplify(Result); disabled
expression_97 = Expression(X=deconstruct_14.XComponent, Expression="FORMAT(\"{0:R}\",X)")  # -> simplify(Result); disabled
panel_194 = Panel(expression_97)  # disabled
panel_195 = Panel(expression_96)  # disabled
curvature_2 = Curvature(Curve=curve_87, Parameter=divide_curve_3.Parameters)  # -> Point, Curvature, Curvature_2; disabled
deconstruct_arc_2 = DeconstructArc(Arc=curvature_2.Curvature_2)  # -> BasePlane, Radius, Angle; disabled
one_over_x_2 = OneOverX(Value=deconstruct_arc_2.Radius)  # -> graft(Result); disabled
expression_98 = Expression(X=one_over_x_2, Expression="FORMAT(\"{0:R}\",X)")  # -> simplify(Result); disabled
list_length_16 = ListLength(List=divide_curve_3.Points)  # disabled
duplicate_data_7 = DuplicateData(Data=",", Number=list_length_16, Order=True)  # -> simplify(graft(Data)); disabled
panel_196 = Panel(duplicate_data_7)  # disabled
panel_197 = Panel(duplicate_data_7)  # disabled
panel_198 = Panel(expression_98)  # disabled
concatenate = Concatenate(FragmentA=panel_194, FragmentB=panel_196, FragmentA_2=panel_195, FragmentA_3=panel_197, FragmentB_2=panel_198)  # -> flatten(Result); disabled
panel_199 = Panel(concatenate)  # disabled
txtwriter = VBScript(filePath=file_path, data=flatten(panel_199), activate=button)  # -> out, A; inputs data: list; disabled
# ---------- txtwriter: VB ----------
    If activate Then

      Dim i As Integer
      Dim aryText(4) As String

      aryText(0) = "Mary WriteLine"
      aryText(1) = "Had"
      aryText(2) = "Another"
      aryText(3) = "Little"
      aryText(4) = "One"

      ' the data is appended to the file. If file doesnt exist, a new file is created
      Dim objWriter As New System.IO.StreamWriter(filePath, append)

      For i = 0 To data.Count - 1
        objWriter.WriteLine(data(i))
      Next

      objWriter.Close()

    End If

    If clearFile Then
      Dim objWriter As New System.IO.StreamWriter(filePath, False)
      objWriter.Close()
    End If
# ---------- end txtwriter ----------

curve_88 = Curve(graft(curve_84))
divide_curve_4 = DivideCurve(Curve=curve_88, Count=number_21, Kinks=False)  # -> Points, Tangents, Parameters
curvature_3 = Curvature(Curve=curve_88, Parameter=divide_curve_4.Parameters)  # -> Point, Curvature, Curvature_2
deconstruct_arc_3 = DeconstructArc(Arc=curvature_3.Curvature_2)  # -> BasePlane, Radius, Angle
expression_99 = Expression(O=deconstruct_arc_3.Radius, Expression="FORMAT(\"{0:R}\",O)")
panel_200 = Panel(expression_99)
quick_graph_17 = QuickGraph(deconstruct_arc_3.Radius, SortOrder=0)
one_over_x_3 = OneOverX(Value=deconstruct_arc_3.Radius)

expression_100 = Expression(O=one_over_x_3, Expression="FORMAT(\"{0:R}\",O)")
panel_201 = Panel(expression_100)

quick_graph_18 = QuickGraph(one_over_x_3, SortOrder=0)
multiplication_18 = Multiplication(A=one_over_x_3, B=digit_scroller_44)
line_sdl_15 = LineSDL(Start=divide_curve.Points, Direction=Vector(0, 1, 0), Length=multiplication_18)

replace_nulls_8 = ReplaceNulls(Items=one_over_x_3, Replacements=0)  # -> Items, Count
relative_differences_8 = RelativeDifferences(Values=replace_nulls_8.Items)

curve_89 = Curve(line_sdl_15)

list_length_17 = ListLength(List=curve_88)  # -> flatten(Length)
mass_addition = MassAddition(Input=list_length_17)  # -> Result, PartialResults
panel_202 = Panel(mass_addition.Result)
series_15 = Series(Start=1, Step=1, Count=panel_202)  # -> graft(Series)
vector_xyz_8 = VectorXYZ(XComponent=expr("-X", series_15), YComponent=0, ZComponent=0)  # -> Vector, Length
move_11 = Move(Geometry=curve_89, Motion=vector_xyz_8.Vector)  # -> Geometry, Transform
evaluate_length_38 = EvaluateLength(Curve=move_11.Geometry, Length=1, Normalized=True)  # -> Point, Tangent, Parameter
interpolate_11 = Interpolate(Vertices=evaluate_length_38.Point, Degree=1, Periodic=False, KnotStyle=2)  # -> Curve, Length, Domain

expression_101 = Expression(O=relative_differences_8, Expression="FORMAT(\"{0:R}\",O)")
panel_203 = Panel(expression_101)
vector_xyz_9 = VectorXYZ(XComponent=expr("-X", series_15), YComponent=0.5, ZComponent=0)  # -> Vector, Length
quick_graph_19 = QuickGraph(relative_differences_8, SortOrder=0)
multiplication_19 = Multiplication(A=relative_differences_8, B=digit_scroller_46)
line_sdl_16 = LineSDL(Start=divide_curve.Points, Direction=Vector(0, 1, 0), Length=multiplication_19)
move_12 = Move(Geometry=line_sdl_16, Motion=vector_xyz_9.Vector)  # -> Geometry, Transform
evaluate_length_39 = EvaluateLength(Curve=move_12.Geometry, Length=1, Normalized=True)  # -> Point, Tangent, Parameter
interpolate_12 = Interpolate(Vertices=evaluate_length_39.Point, Degree=1, Periodic=False, KnotStyle=2)  # -> Curve, Length, Domain

vector_xyz_10 = VectorXYZ(XComponent=expr("-X", series_15), YComponent=1, ZComponent=0)  # -> Vector, Length
replace_nulls_9 = ReplaceNulls(Items=relative_differences_8, Replacements=0)  # -> Items, Count
relative_differences_9 = RelativeDifferences(Values=replace_nulls_9.Items)
expression_102 = Expression(O=relative_differences_9, Expression="FORMAT(\"{0:R}\",O)")
panel_204 = Panel(expression_102)
quick_graph_20 = QuickGraph(relative_differences_9, SortOrder=0)
multiplication_20 = Multiplication(A=relative_differences_9, B=digit_scroller_43)
line_sdl_17 = LineSDL(Start=divide_curve.Points, Direction=Vector(0, 1, 0), Length=multiplication_20)
move_13 = Move(Geometry=line_sdl_17, Motion=vector_xyz_10.Vector)  # -> Geometry, Transform
evaluate_length_40 = EvaluateLength(Curve=move_13.Geometry, Length=1, Normalized=True)  # -> Point, Tangent, Parameter
interpolate_13 = Interpolate(Vertices=evaluate_length_40.Point, Degree=1, Periodic=False, KnotStyle=2)  # -> Curve, Length, Domain

vector_xyz_11 = VectorXYZ(XComponent=expr("-X", series_15), YComponent=1.5, ZComponent=0)  # -> Vector, Length
replace_nulls_10 = ReplaceNulls(Items=relative_differences_9, Replacements=0)  # -> Items, Count
relative_differences_10 = RelativeDifferences(Values=replace_nulls_10.Items)
expression_103 = Expression(O=relative_differences_10, Expression="FORMAT(\"{0:R}\",O)")
panel_205 = Panel(expression_103)
quick_graph_21 = QuickGraph(relative_differences_10, SortOrder=0)
multiplication_21 = Multiplication(A=relative_differences_10, B=digit_scroller_42)
line_sdl_18 = LineSDL(Start=divide_curve.Points, Direction=Vector(0, 1, 0), Length=multiplication_21)
move_14 = Move(Geometry=line_sdl_18, Motion=vector_xyz_11.Vector)  # -> Geometry, Transform
evaluate_length_41 = EvaluateLength(Curve=move_14.Geometry, Length=1, Normalized=True)  # -> Point, Tangent, Parameter
interpolate_14 = Interpolate(Vertices=evaluate_length_41.Point, Degree=1, Periodic=False, KnotStyle=2)  # -> Curve, Length, Domain

vector_xyz_12 = VectorXYZ(XComponent=expr("-X", series_15), YComponent=2, ZComponent=0)  # -> Vector, Length
replace_nulls_11 = ReplaceNulls(Items=relative_differences_10, Replacements=0)  # -> Items, Count
relative_differences_11 = RelativeDifferences(Values=replace_nulls_11.Items)
expression_104 = Expression(O=relative_differences_11, Expression="FORMAT(\"{0:R}\",O)")
panel_206 = Panel(expression_104)
quick_graph_22 = QuickGraph(relative_differences_11, SortOrder=0)
multiplication_22 = Multiplication(A=relative_differences_11, B=digit_scroller_41)
line_sdl_19 = LineSDL(Start=divide_curve.Points, Direction=Vector(0, 1, 0), Length=multiplication_22)
move_15 = Move(Geometry=line_sdl_19, Motion=vector_xyz_12.Vector)  # -> Geometry, Transform
evaluate_length_42 = EvaluateLength(Curve=move_15.Geometry, Length=1, Normalized=True)  # -> Point, Tangent, Parameter
interpolate_15 = Interpolate(Vertices=evaluate_length_42.Point, Degree=1, Periodic=False, KnotStyle=2)  # -> Curve, Length, Domain

vector_xyz_13 = VectorXYZ(XComponent=expr("-X", series_15), YComponent=5, ZComponent=0)  # -> Vector, Length; disabled
replace_nulls_12 = ReplaceNulls(Items=relative_differences_11, Replacements=0)  # -> Items, Count; disabled
relative_differences_12 = RelativeDifferences(Values=replace_nulls_12.Items)  # disabled
expression_105 = Expression(O=relative_differences_12, Expression="FORMAT(\"{0:R}\",O)")  # disabled
panel_207 = Panel(expression_105)  # disabled
quick_graph_23 = QuickGraph(relative_differences_12, SortOrder=0)  # disabled
multiplication_23 = Multiplication(A=relative_differences_12, B=digit_scroller_47)  # disabled
line_sdl_20 = LineSDL(Start=divide_curve.Points, Direction=Vector(0, 1, 0), Length=multiplication_23)  # disabled
move_16 = Move(Geometry=line_sdl_20, Motion=vector_xyz_13.Vector)  # -> Geometry, Transform; disabled
evaluate_length_43 = EvaluateLength(Curve=move_16.Geometry, Length=1, Normalized=True)  # -> Point, Tangent, Parameter; disabled
interpolate_16 = Interpolate(Vertices=evaluate_length_43.Point, Degree=1, Periodic=False, KnotStyle=2)  # -> Curve, Length, Domain; disabled

replace_nulls_13 = ReplaceNulls(Items=relative_differences_12, Replacements=0)  # -> Items, Count; disabled
relative_differences_13 = RelativeDifferences(Values=replace_nulls_13.Items)  # disabled

expression_106 = Expression(O=relative_differences_13, Expression="FORMAT(\"{0:R}\",O)")  # disabled
panel_208 = Panel(expression_106)  # disabled
vector_xyz_14 = VectorXYZ(XComponent=expr("-X", series_15), YComponent=6, ZComponent=0)  # -> Vector, Length; disabled
quick_graph_24 = QuickGraph(relative_differences_13, SortOrder=0)  # disabled
multiplication_24 = Multiplication(A=relative_differences_13, B=digit_scroller_48)  # disabled
line_sdl_21 = LineSDL(Start=divide_curve.Points, Direction=Vector(0, 1, 0), Length=multiplication_24)  # disabled
move_17 = Move(Geometry=line_sdl_21, Motion=vector_xyz_14.Vector)  # -> Geometry, Transform; disabled
evaluate_length_44 = EvaluateLength(Curve=move_17.Geometry, Length=1, Normalized=True)  # -> Point, Tangent, Parameter; disabled
interpolate_17 = Interpolate(Vertices=evaluate_length_44.Point, Degree=1, Periodic=False, KnotStyle=2)  # -> Curve, Length, Domain; disabled

vector_xyz_15 = VectorXYZ(XComponent=expr("-X", series_15), YComponent=7, ZComponent=0)  # -> Vector, Length; disabled
replace_nulls_14 = ReplaceNulls(Items=relative_differences_13, Replacements=0)  # -> Items, Count; disabled
relative_differences_14 = RelativeDifferences(Values=replace_nulls_14.Items)  # disabled
expression_107 = Expression(O=relative_differences_14, Expression="FORMAT(\"{0:R}\",O)")  # disabled
panel_209 = Panel(expression_107)  # disabled
quick_graph_25 = QuickGraph(relative_differences_14, SortOrder=0)  # disabled
multiplication_25 = Multiplication(A=relative_differences_14, B=digit_scroller_45)  # disabled
line_sdl_22 = LineSDL(Start=divide_curve.Points, Direction=Vector(0, 1, 0), Length=multiplication_25)  # disabled
move_18 = Move(Geometry=line_sdl_22, Motion=vector_xyz_15.Vector)  # -> Geometry, Transform; disabled
evaluate_length_45 = EvaluateLength(Curve=move_18.Geometry, Length=1, Normalized=True)  # -> Point, Tangent, Parameter; disabled
interpolate_18 = Interpolate(Vertices=evaluate_length_45.Point, Degree=1, Periodic=False, KnotStyle=2)  # -> Curve, Length, Domain; disabled

vector_xyz_16 = VectorXYZ(XComponent=expr("-X", series_15), YComponent=8, ZComponent=0)  # -> Vector, Length; disabled
replace_nulls_15 = ReplaceNulls(Items=relative_differences_14, Replacements=0)  # -> Items, Count; disabled
relative_differences_15 = RelativeDifferences(Values=replace_nulls_15.Items)  # disabled
expression_108 = Expression(O=relative_differences_15, Expression="FORMAT(\"{0:R}\",O)")  # disabled
panel_210 = Panel(expression_108)  # disabled
quick_graph_26 = QuickGraph(relative_differences_15, SortOrder=0)  # disabled
multiplication_26 = Multiplication(A=relative_differences_15, B=digit_scroller_49)  # disabled
line_sdl_23 = LineSDL(Start=divide_curve.Points, Direction=Vector(0, 1, 0), Length=multiplication_26)  # disabled
move_19 = Move(Geometry=line_sdl_23, Motion=vector_xyz_16.Vector)  # -> Geometry, Transform; disabled
evaluate_length_46 = EvaluateLength(Curve=move_19.Geometry, Length=1, Normalized=True)  # -> Point, Tangent, Parameter; disabled
interpolate_19 = Interpolate(Vertices=evaluate_length_46.Point, Degree=1, Periodic=False, KnotStyle=2)  # -> Curve, Length, Domain; disabled

custom_preview_20 = CustomPreview(Geometry=interpolate_15.Curve, Material=create_material_3)

custom_preview_21 = CustomPreview(Geometry=move_15.Geometry, Material=create_material_4)

custom_preview_22 = CustomPreview(Geometry=interpolate_14.Curve, Material=create_material_5)

custom_preview_23 = CustomPreview(Geometry=move_14.Geometry, Material=create_material_6)

custom_preview_24 = CustomPreview(Geometry=interpolate_13.Curve, Material=create_material_7)

custom_preview_25 = CustomPreview(Geometry=move_13.Geometry, Material=create_material_8)

custom_preview_26 = CustomPreview(Geometry=interpolate_12.Curve, Material=create_material_9)

custom_preview_27 = CustomPreview(Geometry=move_12.Geometry, Material=create_material_10)

custom_preview_28 = CustomPreview(Geometry=interpolate_11.Curve, Material=create_material_11)

custom_preview_29 = CustomPreview(Geometry=move_11.Geometry, Material=create_material_12)

custom_preview_30 = CustomPreview(Geometry=interpolate_19.Curve, Material=create_material_13)  # disabled

custom_preview_31 = CustomPreview(Geometry=move_19.Geometry, Material=create_material_14)  # disabled

custom_preview_32 = CustomPreview(Geometry=interpolate_18.Curve, Material=create_material_15)  # disabled

custom_preview_33 = CustomPreview(Geometry=move_18.Geometry, Material=create_material_16)  # disabled

custom_preview_34 = CustomPreview(Geometry=interpolate_16.Curve, Material=create_material_17)  # disabled

custom_preview_35 = CustomPreview(Geometry=move_16.Geometry, Material=create_material_18)  # disabled

custom_preview_36 = CustomPreview(Geometry=interpolate_17.Curve, Material=create_material_19)  # disabled

custom_preview_37 = CustomPreview(Geometry=move_17.Geometry, Material=create_material_20)  # disabled

number_29 = Number(number_14)  # disabled

series_16 = Series(Start=0, Step=panel_98, Count=number_29)  # disabled
expression_109 = Expression(O=series_16, Expression="FORMAT(\"{0:R}\",O)")  # disabled
panel_211 = Panel(expression_109)  # disabled
bounds_14 = Bounds(Numbers=series_16)  # disabled
expression_110 = Expression(X=number_29, O=number_9, Expression="X^O")  # disabled
duplicate_data_8 = DuplicateData(Data=expression_110, Number=number_29, Order=True)  # disabled

curve_graph_mapper_6 = CurveGraphMapper(Curves=curve_4, Rectangle=rectangle_2pt.Rectangle, Values=series_16, Flip=False, Snap=True, TextSize=0.015625)  # -> Mapped, GraphCurves, GraphPoints, ValueLines, ValuePoints, MappedLines, MappedPoints, Boundary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; disabled
graphmapper_6 = GraphMapper(Curve=curve_4, Boundary=rectangle_2pt.Rectangle, Numbers=series_16, Input=bounds_14, Output=bounds_14, bobo=True)  # disabled
stream_filter_13 = StreamFilter(Gate=number_slider_2, Stream0=curve_graph_mapper_6.Mapped, Stream1=graphmapper_6)  # disabled

turtle_7 = DotNETVBScriptLEGACY(Forward=duplicate_data_8, Left=stream_filter_13)  # -> Output, Points; inputs Forward: list, Left: list; disabled; same code as turtle

expression_111 = Expression(O=turtle_7.Points, Expression="FORMAT(\"{0:R}\",O)")  # disabled
panel_212 = Panel(expression_111)  # disabled

point_12 = Point(turtle_7.Points)  # disabled
scale_25 = Scale(Geometry=point_12, Center=Point(0, 0, 0), Factor=expr("2^X", digit_scroller_68))  # -> Geometry, Transform; disabled

interpolate_t_7 = InterpolateT(Vertices=scale_25.Geometry, TangentStart=Vector(0.0625, 0, 0), TangentEnd=Vector(0, 0, 0), KnotStyle=2)  # -> Curve, Length, Domain; disabled
evaluate_length_47 = EvaluateLength(Curve=interpolate_t_7.Curve, Length=1, Normalized=True)  # -> Point, Tangent, Parameter; disabled
line_sdl_24 = LineSDL(Start=evaluate_length_47.Point, Direction=evaluate_length_47.Tangent, Length=1)  # disabled
mirror_8 = Mirror(Geometry=interpolate_t_7.Curve, Plane=line_sdl_24)  # -> Geometry, Transform; disabled
join_curves_9 = JoinCurves(Curves=[interpolate_t_7.Curve, mirror_8.Geometry], Preserve=False)  # disabled
evaluate_length_48 = EvaluateLength(Curve=join_curves_9, Length=1, Normalized=True)  # -> Point, Tangent, Parameter; disabled
rotate_7 = Rotate(Geometry=join_curves_9, Angle=3.141592654, Plane=evaluate_length_48.Point)  # -> Geometry, Transform; disabled
join_curves_10 = JoinCurves(Curves=[join_curves_9, rotate_7.Geometry], Preserve=False)  # disabled
curve_90 = Curve(join_curves_10)  # disabled

evaluate_length_49 = EvaluateLength(Curve=join_curves_10, Length=1, Normalized=True)  # -> Point, Tangent, Parameter; disabled
deconstruct_15 = Deconstruct(Point=evaluate_length_49.Point)  # -> XComponent, YComponent, ZComponent; disabled
expression_112 = Expression(O=deconstruct_15.YComponent, Expression="FORMAT(\"{0:R}\",O)")  # disabled
expression_113 = Expression(O=deconstruct_15.XComponent, Expression="FORMAT(\"{0:R}\",O)")  # disabled
expression_114 = Expression(O=deconstruct_15.ZComponent, Expression="FORMAT(\"{0:R}\",O)")  # disabled
panel_213 = Panel(expression_112)  # disabled
panel_214 = Panel(expression_113)  # disabled
panel_215 = Panel(expression_114)  # disabled
addition_8 = Addition(A=panel_213, B=panel_214)  # disabled
expression_115 = Expression(O=addition_8, Expression="FORMAT(\"{0:R}\",O)")  # disabled
panel_216 = Panel(expression_115)  # disabled
division_13 = Division(A=panel_216, B=2)  # disabled
expression_116 = Expression(O=division_13, Expression="FORMAT(\"{0:R}\",O)")  # disabled
panel_217 = Panel(expression_116)  # disabled
scale_26 = Scale(Geometry=scale_25.Geometry, Center=Point(0, 0, 0), Factor=expr("1/X", panel_217))  # -> Geometry, Transform; disabled
scale_27 = Scale(Geometry=curve_90, Center=Point(0, 0, 0), Factor=expr("1/X", panel_217))  # -> Geometry, Transform; disabled
evaluate_length_50 = EvaluateLength(Curve=scale_27.Geometry, Length=1, Normalized=True)  # -> Point, Tangent, Parameter; disabled
deconstruct_16 = Deconstruct(Point=evaluate_length_50.Point)  # -> XComponent, YComponent, ZComponent; disabled
expression_117 = Expression(O=deconstruct_16.YComponent, Expression="FORMAT(\"{0:R}\",O)")  # disabled
expression_118 = Expression(O=deconstruct_16.XComponent, Expression="FORMAT(\"{0:R}\",O)")  # disabled
expression_119 = Expression(O=deconstruct_16.ZComponent, Expression="FORMAT(\"{0:R}\",O)")  # disabled
panel_218 = Panel(expression_117)  # disabled
panel_219 = Panel(expression_118)  # disabled
panel_220 = Panel(expression_119)  # disabled
division_14 = Division(A=panel_214, B=panel_213)  # disabled
expression_120 = Expression(O=division_14, Expression="FORMAT(\"{0:R}\",O)")  # disabled
panel_221 = Panel(expression_120)  # disabled
curve_91 = Curve(scale_27.Geometry)  # disabled
point_13 = Point(scale_26.Geometry)  # disabled

move_20 = Move(Geometry=curve_91, Motion=vector_xyz_3.Vector)  # -> Geometry, Transform; disabled
mirror_9 = Mirror(Geometry=curve_91, Plane=PlaneYZ(0, 0, 0))  # -> Geometry, Transform; disabled
curve_92 = Curve(move_20.Geometry)  # disabled

number_30 = Number(number_14)  # disabled

series_17 = Series(Start=0, Step=panel_78, Count=number_30)  # disabled
expression_121 = Expression(O=series_17, Expression="FORMAT(\"{0:R}\",O)")  # disabled
panel_223 = Panel(expression_121)  # disabled
bounds_15 = Bounds(Numbers=series_17)  # disabled
expression_122 = Expression(X=number_30, O=number_10, Expression="X^O")  # disabled
duplicate_data_9 = DuplicateData(Data=expression_122, Number=number_30, Order=True)  # disabled

curve_graph_mapper_7 = CurveGraphMapper(Curves=curve_8, Rectangle=rectangle_2pt_2.Rectangle, Values=series_17, Flip=False, Snap=True, TextSize=0.015625)  # -> Mapped, GraphCurves, GraphPoints, ValueLines, ValuePoints, MappedLines, MappedPoints, Boundary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; disabled
graphmapper_7 = GraphMapper(Curve=curve_8, Boundary=rectangle_2pt_2.Rectangle, Numbers=series_17, Input=bounds_15, Output=bounds_15, bobo=True)  # disabled
stream_filter_14 = StreamFilter(Gate=number_slider_2, Stream0=curve_graph_mapper_7.Mapped, Stream1=graphmapper_7)  # disabled

turtle_8 = DotNETVBScriptLEGACY(Forward=duplicate_data_9, Left=stream_filter_14)  # -> Output, Points; inputs Forward: list, Left: list; disabled; same code as turtle

expression_123 = Expression(O=turtle_8.Points, Expression="FORMAT(\"{0:R}\",O)")  # disabled
panel_224 = Panel(expression_123)  # disabled

point_14 = Point(turtle_8.Points)  # disabled
scale_28 = Scale(Geometry=point_14, Center=Point(0, 0, 0), Factor=expr("2^X", digit_scroller_83))  # -> Geometry, Transform; disabled

interpolate_t_8 = InterpolateT(Vertices=scale_28.Geometry, TangentStart=Vector(0.0625, 0, 0), TangentEnd=Vector(0, 0, 0), KnotStyle=2)  # -> Curve, Length, Domain; disabled
evaluate_length_51 = EvaluateLength(Curve=interpolate_t_8.Curve, Length=1, Normalized=True)  # -> Point, Tangent, Parameter; disabled
line_sdl_25 = LineSDL(Start=evaluate_length_51.Point, Direction=evaluate_length_51.Tangent, Length=1)  # disabled
mirror_10 = Mirror(Geometry=interpolate_t_8.Curve, Plane=line_sdl_25)  # -> Geometry, Transform; disabled
join_curves_11 = JoinCurves(Curves=[interpolate_t_8.Curve, mirror_10.Geometry], Preserve=False)  # disabled
evaluate_length_52 = EvaluateLength(Curve=join_curves_11, Length=1, Normalized=True)  # -> Point, Tangent, Parameter; disabled
rotate_8 = Rotate(Geometry=join_curves_11, Angle=3.141592654, Plane=evaluate_length_52.Point)  # -> Geometry, Transform; disabled
join_curves_12 = JoinCurves(Curves=[join_curves_11, rotate_8.Geometry], Preserve=False)  # disabled
curve_93 = Curve(join_curves_12)  # disabled

evaluate_length_53 = EvaluateLength(Curve=join_curves_12, Length=1, Normalized=True)  # -> Point, Tangent, Parameter; disabled
deconstruct_17 = Deconstruct(Point=evaluate_length_53.Point)  # -> XComponent, YComponent, ZComponent; disabled
expression_124 = Expression(O=deconstruct_17.YComponent, Expression="FORMAT(\"{0:R}\",O)")  # disabled
expression_125 = Expression(O=deconstruct_17.XComponent, Expression="FORMAT(\"{0:R}\",O)")  # disabled
expression_126 = Expression(O=deconstruct_17.ZComponent, Expression="FORMAT(\"{0:R}\",O)")  # disabled
panel_225 = Panel(expression_124)  # disabled
panel_226 = Panel(expression_125)  # disabled
panel_227 = Panel(expression_126)  # disabled
addition_9 = Addition(A=panel_225, B=panel_226)  # disabled
expression_127 = Expression(O=addition_9, Expression="FORMAT(\"{0:R}\",O)")  # disabled
panel_228 = Panel(expression_127)  # disabled
division_15 = Division(A=panel_228, B=2)  # disabled
expression_128 = Expression(O=division_15, Expression="FORMAT(\"{0:R}\",O)")  # disabled
panel_229 = Panel(expression_128)  # disabled
scale_29 = Scale(Geometry=scale_28.Geometry, Center=Point(0, 0, 0), Factor=expr("1/X", panel_229))  # -> Geometry, Transform; disabled
scale_30 = Scale(Geometry=curve_93, Center=Point(0, 0, 0), Factor=expr("1/X", panel_229))  # -> Geometry, Transform; disabled
evaluate_length_54 = EvaluateLength(Curve=scale_30.Geometry, Length=1, Normalized=True)  # -> Point, Tangent, Parameter; disabled
deconstruct_18 = Deconstruct(Point=evaluate_length_54.Point)  # -> XComponent, YComponent, ZComponent; disabled
expression_129 = Expression(O=deconstruct_18.YComponent, Expression="FORMAT(\"{0:R}\",O)")  # disabled
expression_130 = Expression(O=deconstruct_18.XComponent, Expression="FORMAT(\"{0:R}\",O)")  # disabled
expression_131 = Expression(O=deconstruct_18.ZComponent, Expression="FORMAT(\"{0:R}\",O)")  # disabled
panel_230 = Panel(expression_129)  # disabled
panel_231 = Panel(expression_130)  # disabled
panel_232 = Panel(expression_131)  # disabled
division_16 = Division(A=panel_226, B=panel_225)  # disabled
expression_132 = Expression(O=division_16, Expression="FORMAT(\"{0:R}\",O)")  # disabled
panel_233 = Panel(expression_132)  # disabled
curve_94 = Curve(scale_30.Geometry)  # disabled
point_15 = Point(scale_29.Geometry)  # disabled

move_21 = Move(Geometry=curve_94, Motion=Vector(7.5, 0, 0))  # -> Geometry, Transform; disabled
mirror_11 = Mirror(Geometry=curve_94, Plane=PlaneYZ(0, 0, 0))  # -> Geometry, Transform; disabled
curve_95 = Curve(move_21.Geometry)  # disabled

curve_96 = Curve(curve_94)  # disabled
end_points_12 = EndPoints(Curve=curve_96)  # -> Start, End; disabled
rectangle_2pt_12 = Rectangle2Pt(Plane=PlaneXY(0, 0, 0), PointA=end_points_12.Start, PointB=end_points_12.End, Radius=0)  # -> Rectangle, Length; disabled
deconstuct_rectangle_5 = DeconstuctRectangle(Rectangle=rectangle_2pt_12.Rectangle)  # -> BasePlane, XInterval, YInterval; disabled
deconstruct_domain_9 = DeconstructDomain(Domain=deconstuct_rectangle_5.YInterval)  # -> Start, End; disabled
deconstruct_domain_10 = DeconstructDomain(Domain=deconstuct_rectangle_5.XInterval)  # -> Start, End; disabled
scale_nu_6 = ScaleNU(
    Geometry=curve_94,
    Plane=PlaneXY(0, 0, 0),
    ScaleX=expr("1/X", deconstruct_domain_10.End),
    ScaleY=expr("1/X", deconstruct_domain_9.End),
    ScaleZ=1)  # -> Geometry, Transform; disabled
curve_97 = Curve(scale_nu_6.Geometry)  # disabled
move_22 = Move(Geometry=curve_97, Motion=vector_xyz_5.Vector)  # -> Geometry, Transform; disabled
curve_98 = Curve(move_22.Geometry)  # disabled

stream_filter_15 = StreamFilter(Gate=number_slider, Stream0=curve_94, Stream1=curve_97)  # disabled
curve_99 = Curve(stream_filter_15)  # disabled
scale_31 = Scale(Geometry=curve_99, Center=Point(0, 0, 0), Factor=expr("2^X", number_2))  # -> Geometry, Transform; disabled
curve_100 = Curve(scale_31.Geometry)  # disabled

stream_filter_16 = StreamFilter(Gate=number_slider, Stream0=curve_94, Stream1=curve_97)  # disabled
curve_101 = Curve(stream_filter_16)  # disabled
scale_32 = Scale(Geometry=curve_101, Center=Point(0, 0, 0), Factor=expr("2^X", number_2))  # -> Geometry, Transform; disabled
curve_102 = Curve(scale_32.Geometry)  # disabled

end_points_13 = EndPoints(Curve=curve_100)  # -> Start, End; disabled
rectangle_2pt_13 = Rectangle2Pt(Plane=PlaneXY(0, 0, 0), PointA=end_points_13.Start, PointB=end_points_13.End, Radius=0)  # -> Rectangle, Length; disabled

number_31 = Number(number_14)  # disabled

series_18 = Series(Start=0, Step=panel_99, Count=number_31)  # disabled
expression_133 = Expression(O=series_18, Expression="FORMAT(\"{0:R}\",O)")  # disabled
panel_235 = Panel(expression_133)  # disabled
bounds_16 = Bounds(Numbers=series_18)  # disabled
expression_134 = Expression(X=number_31, O=number_11, Expression="X^O")  # disabled
duplicate_data_10 = DuplicateData(Data=expression_134, Number=number_31, Order=True)  # disabled

curve_graph_mapper_8 = CurveGraphMapper(Curves=curve_100, Rectangle=rectangle_2pt_13.Rectangle, Values=series_18, Flip=False, Snap=True, TextSize=0.015625)  # -> Mapped, GraphCurves, GraphPoints, ValueLines, ValuePoints, MappedLines, MappedPoints, Boundary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; disabled
graphmapper_8 = GraphMapper(Curve=curve_100, Boundary=rectangle_2pt_13.Rectangle, Numbers=series_18, Input=bounds_16, Output=bounds_16, bobo=True)  # disabled
stream_filter_17 = StreamFilter(Gate=number_slider_2, Stream0=curve_graph_mapper_8.Mapped, Stream1=graphmapper_8)  # disabled

turtle_9 = DotNETVBScriptLEGACY(Forward=duplicate_data_10, Left=stream_filter_17)  # -> Output, Points; inputs Forward: list, Left: list; disabled; same code as turtle

expression_135 = Expression(O=turtle_9.Points, Expression="FORMAT(\"{0:R}\",O)")  # disabled
panel_236 = Panel(expression_135)  # disabled

point_16 = Point(turtle_9.Points)  # disabled
scale_33 = Scale(Geometry=point_16, Center=Point(0, 0, 0), Factor=expr("2^X", digit_scroller_84))  # -> Geometry, Transform; disabled

interpolate_t_9 = InterpolateT(Vertices=scale_33.Geometry, TangentStart=Vector(0.0625, 0, 0), TangentEnd=Vector(0, 0, 0), KnotStyle=2)  # -> Curve, Length, Domain; disabled
evaluate_length_55 = EvaluateLength(Curve=interpolate_t_9.Curve, Length=1, Normalized=True)  # -> Point, Tangent, Parameter; disabled
line_sdl_26 = LineSDL(Start=evaluate_length_55.Point, Direction=evaluate_length_55.Tangent, Length=1)  # disabled
mirror_12 = Mirror(Geometry=interpolate_t_9.Curve, Plane=line_sdl_26)  # -> Geometry, Transform; disabled
join_curves_13 = JoinCurves(Curves=[interpolate_t_9.Curve, mirror_12.Geometry], Preserve=False)  # disabled
evaluate_length_56 = EvaluateLength(Curve=join_curves_13, Length=1, Normalized=True)  # -> Point, Tangent, Parameter; disabled
rotate_9 = Rotate(Geometry=join_curves_13, Angle=3.141592654, Plane=evaluate_length_56.Point)  # -> Geometry, Transform; disabled
join_curves_14 = JoinCurves(Curves=[join_curves_13, rotate_9.Geometry], Preserve=False)  # disabled
curve_103 = Curve(join_curves_14)  # disabled

evaluate_length_57 = EvaluateLength(Curve=join_curves_14, Length=1, Normalized=True)  # -> Point, Tangent, Parameter; disabled
deconstruct_19 = Deconstruct(Point=evaluate_length_57.Point)  # -> XComponent, YComponent, ZComponent; disabled
expression_136 = Expression(O=deconstruct_19.YComponent, Expression="FORMAT(\"{0:R}\",O)")  # disabled
expression_137 = Expression(O=deconstruct_19.XComponent, Expression="FORMAT(\"{0:R}\",O)")  # disabled
expression_138 = Expression(O=deconstruct_19.ZComponent, Expression="FORMAT(\"{0:R}\",O)")  # disabled
panel_237 = Panel(expression_136)  # disabled
panel_238 = Panel(expression_137)  # disabled
panel_239 = Panel(expression_138)  # disabled
addition_10 = Addition(A=panel_237, B=panel_238)  # disabled
expression_139 = Expression(O=addition_10, Expression="FORMAT(\"{0:R}\",O)")  # disabled
panel_240 = Panel(expression_139)  # disabled
division_17 = Division(A=panel_240, B=2)  # disabled
expression_140 = Expression(O=division_17, Expression="FORMAT(\"{0:R}\",O)")  # disabled
panel_241 = Panel(expression_140)  # disabled
scale_34 = Scale(Geometry=scale_33.Geometry, Center=Point(0, 0, 0), Factor=expr("1/X", panel_241))  # -> Geometry, Transform; disabled
scale_35 = Scale(Geometry=curve_103, Center=Point(0, 0, 0), Factor=expr("1/X", panel_241))  # -> Geometry, Transform; disabled
evaluate_length_58 = EvaluateLength(Curve=scale_35.Geometry, Length=1, Normalized=True)  # -> Point, Tangent, Parameter; disabled
deconstruct_20 = Deconstruct(Point=evaluate_length_58.Point)  # -> XComponent, YComponent, ZComponent; disabled
expression_141 = Expression(O=deconstruct_20.YComponent, Expression="FORMAT(\"{0:R}\",O)")  # disabled
expression_142 = Expression(O=deconstruct_20.XComponent, Expression="FORMAT(\"{0:R}\",O)")  # disabled
expression_143 = Expression(O=deconstruct_20.ZComponent, Expression="FORMAT(\"{0:R}\",O)")  # disabled
panel_242 = Panel(expression_141)  # disabled
panel_243 = Panel(expression_142)  # disabled
panel_244 = Panel(expression_143)  # disabled
division_18 = Division(A=panel_238, B=panel_237)  # disabled
expression_144 = Expression(O=division_18, Expression="FORMAT(\"{0:R}\",O)")  # disabled
panel_245 = Panel(expression_144)  # disabled
curve_104 = Curve(scale_35.Geometry)  # disabled
point_17 = Point(scale_34.Geometry)  # disabled

move_23 = Move(Geometry=curve_104, Motion=vector_xyz_4.Vector)  # -> Geometry, Transform; disabled
mirror_13 = Mirror(Geometry=curve_104, Plane=PlaneYZ(0, 0, 0))  # -> Geometry, Transform; disabled
curve_105 = Curve(move_23.Geometry)  # disabled

number_32 = Number(expr("X*4", number_13))  # disabled
divide_curve_5 = DivideCurve(Curve=line_sdl_4, Count=expr("X/2", number_32), Kinks=False)  # -> Points, Tangents, Parameters; disabled
line_sdl_27 = LineSDL(Start=divide_curve_5.Points, Direction=Vector(0, 1, 0), Length=1)  # disabled
scale_36 = Scale(Geometry=line_sdl_27, Center=Point(0, 0, 0), Factor=expr("2^X", number_12))  # -> Geometry, Transform; disabled

number_33 = Number(expr("X*4", number_13))  # disabled

end_points_14 = EndPoints(Curve=curve_102)  # -> Start, End; disabled
rectangle_2pt_14 = Rectangle2Pt(Plane=PlaneXY(0, 0, 0), PointA=end_points_14.Start, PointB=end_points_14.End, Radius=0)  # -> Rectangle, Length; disabled

number_34 = Number(number_14)  # disabled

series_19 = Series(Start=0, Step=panel_100, Count=number_34)  # disabled
expression_145 = Expression(O=series_19, Expression="FORMAT(\"{0:R}\",O)")  # disabled
panel_247 = Panel(expression_145)  # disabled
bounds_17 = Bounds(Numbers=series_19)  # disabled
expression_146 = Expression(X=number_34, Expression="1/X")  # disabled
duplicate_data_11 = DuplicateData(Data=expression_146, Number=number_34, Order=True)  # disabled

number_35 = Number(number_14)  # disabled

series_20 = Series(Start=0, Step=panel_88, Count=number_35)  # disabled
expression_147 = Expression(O=series_20, Expression="FORMAT(\"{0:R}\",O)")  # disabled
panel_248 = Panel(expression_147)  # disabled
bounds_18 = Bounds(Numbers=series_20)  # disabled
expression_148 = Expression(X=number_35, Expression="X")  # disabled
duplicate_data_12 = DuplicateData(Data=expression_148, Number=number_35, Order=True)  # disabled

curve_graph_mapper_9 = CurveGraphMapper(Curves=curve_102, Rectangle=rectangle_2pt_14.Rectangle, Values=series_20, Flip=False, Snap=True, TextSize=0.015625)  # -> Mapped, GraphCurves, GraphPoints, ValueLines, ValuePoints, MappedLines, MappedPoints, Boundary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; disabled
graphmapper_9 = GraphMapper(Curve=curve_102, Boundary=rectangle_2pt_14.Rectangle, Numbers=series_20, Input=bounds_18, Output=bounds_18, bobo=True)  # disabled
stream_filter_18 = StreamFilter(Gate=number_slider_2, Stream0=curve_graph_mapper_9.Mapped, Stream1=graphmapper_9)  # disabled

turtle_10 = DotNETVBScriptLEGACY(Forward=duplicate_data_12, Left=stream_filter_18)  # -> Output, Points; inputs Forward: list, Left: list; disabled; same code as turtle

expression_149 = Expression(O=turtle_10.Points, Expression="FORMAT(\"{0:R}\",O)")  # disabled
panel_249 = Panel(expression_149)  # disabled

point_18 = Point(turtle_10.Points)  # disabled
scale_37 = Scale(Geometry=point_18, Center=Point(0, 0, 0), Factor=expr("2^X", digit_scroller_92))  # -> Geometry, Transform; disabled

interpolate_t_10 = InterpolateT(Vertices=scale_37.Geometry, TangentStart=Vector(0.0625, 0, 0), TangentEnd=Vector(0, 0, 0), KnotStyle=2)  # -> Curve, Length, Domain; disabled
evaluate_length_59 = EvaluateLength(Curve=interpolate_t_10.Curve, Length=1, Normalized=True)  # -> Point, Tangent, Parameter; disabled
line_sdl_28 = LineSDL(Start=evaluate_length_59.Point, Direction=evaluate_length_59.Tangent, Length=1)  # disabled
mirror_14 = Mirror(Geometry=interpolate_t_10.Curve, Plane=line_sdl_28)  # -> Geometry, Transform; disabled
join_curves_15 = JoinCurves(Curves=[interpolate_t_10.Curve, mirror_14.Geometry], Preserve=False)  # disabled
evaluate_length_60 = EvaluateLength(Curve=join_curves_15, Length=1, Normalized=True)  # -> Point, Tangent, Parameter; disabled
rotate_10 = Rotate(Geometry=join_curves_15, Angle=3.141592654, Plane=evaluate_length_60.Point)  # -> Geometry, Transform; disabled
join_curves_16 = JoinCurves(Curves=[join_curves_15, rotate_10.Geometry], Preserve=False)  # disabled
curve_106 = Curve(join_curves_16)  # disabled

evaluate_length_61 = EvaluateLength(Curve=join_curves_16, Length=1, Normalized=True)  # -> Point, Tangent, Parameter; disabled
deconstruct_21 = Deconstruct(Point=evaluate_length_61.Point)  # -> XComponent, YComponent, ZComponent; disabled
expression_150 = Expression(O=deconstruct_21.YComponent, Expression="FORMAT(\"{0:R}\",O)")  # disabled
expression_151 = Expression(O=deconstruct_21.XComponent, Expression="FORMAT(\"{0:R}\",O)")  # disabled
expression_152 = Expression(O=deconstruct_21.ZComponent, Expression="FORMAT(\"{0:R}\",O)")  # disabled
panel_250 = Panel(expression_150)  # disabled
panel_251 = Panel(expression_151)  # disabled
panel_252 = Panel(expression_152)  # disabled
addition_11 = Addition(A=panel_250, B=panel_251)  # disabled
expression_153 = Expression(O=addition_11, Expression="FORMAT(\"{0:R}\",O)")  # disabled
panel_253 = Panel(expression_153)  # disabled
division_19 = Division(A=panel_253, B=2)  # disabled
expression_154 = Expression(O=division_19, Expression="FORMAT(\"{0:R}\",O)")  # disabled
panel_254 = Panel(expression_154)  # disabled
scale_38 = Scale(Geometry=scale_37.Geometry, Center=Point(0, 0, 0), Factor=expr("1/X", panel_254))  # -> Geometry, Transform; disabled
scale_39 = Scale(Geometry=curve_106, Center=Point(0, 0, 0), Factor=expr("1/X", panel_254))  # -> Geometry, Transform; disabled
evaluate_length_62 = EvaluateLength(Curve=scale_39.Geometry, Length=1, Normalized=True)  # -> Point, Tangent, Parameter; disabled
deconstruct_22 = Deconstruct(Point=evaluate_length_62.Point)  # -> XComponent, YComponent, ZComponent; disabled
expression_155 = Expression(O=deconstruct_22.YComponent, Expression="FORMAT(\"{0:R}\",O)")  # disabled
expression_156 = Expression(O=deconstruct_22.XComponent, Expression="FORMAT(\"{0:R}\",O)")  # disabled
expression_157 = Expression(O=deconstruct_22.ZComponent, Expression="FORMAT(\"{0:R}\",O)")  # disabled
panel_255 = Panel(expression_155)  # disabled
panel_256 = Panel(expression_156)  # disabled
panel_257 = Panel(expression_157)  # disabled
division_20 = Division(A=panel_251, B=panel_250)  # disabled
expression_158 = Expression(O=division_20, Expression="FORMAT(\"{0:R}\",O)")  # disabled
panel_258 = Panel(expression_158)  # disabled
curve_107 = Curve(scale_39.Geometry)  # disabled
point_19 = Point(scale_38.Geometry)  # disabled

move_24 = Move(Geometry=curve_107, Motion=Vector(10, 0, 0))  # -> Geometry, Transform; disabled
mirror_15 = Mirror(Geometry=curve_107, Plane=PlaneYZ(0, 0, 0))  # -> Geometry, Transform; disabled
curve_108 = Curve(move_24.Geometry)  # disabled

curve_109 = Curve(curve_107)  # disabled
end_points_15 = EndPoints(Curve=curve_109)  # -> Start, End; disabled
rectangle_2pt_15 = Rectangle2Pt(Plane=PlaneXY(0, 0, 0), PointA=end_points_15.Start, PointB=end_points_15.End, Radius=0)  # -> Rectangle, Length; disabled
deconstuct_rectangle_6 = DeconstuctRectangle(Rectangle=rectangle_2pt_15.Rectangle)  # -> BasePlane, XInterval, YInterval; disabled
deconstruct_domain_11 = DeconstructDomain(Domain=deconstuct_rectangle_6.YInterval)  # -> Start, End; disabled
deconstruct_domain_12 = DeconstructDomain(Domain=deconstuct_rectangle_6.XInterval)  # -> Start, End; disabled
scale_nu_7 = ScaleNU(
    Geometry=curve_107,
    Plane=PlaneXY(0, 0, 0),
    ScaleX=expr("1/X", deconstruct_domain_12.End),
    ScaleY=expr("1/X", deconstruct_domain_11.End),
    ScaleZ=1)  # -> Geometry, Transform; disabled
curve_110 = Curve(scale_nu_7.Geometry)  # disabled
move_25 = Move(Geometry=curve_110, Motion=vector_xyz_7.Vector)  # -> Geometry, Transform; disabled
curve_111 = Curve(move_25.Geometry)  # disabled

stream_filter_19 = StreamFilter(Gate=number_slider, Stream0=curve_107, Stream1=curve_110)  # disabled
curve_112 = Curve(stream_filter_19)  # disabled
scale_40 = Scale(Geometry=curve_112, Center=Point(0, 0, 0), Factor=expr("2^X", number_2))  # -> Geometry, Transform; disabled
curve_113 = Curve(scale_40.Geometry)  # disabled

stream_filter_20 = StreamFilter(Gate=number_slider, Stream0=curve_107, Stream1=curve_110)  # disabled
curve_114 = Curve(stream_filter_20)  # disabled
scale_41 = Scale(Geometry=curve_114, Center=Point(0, 0, 0), Factor=expr("2^X", number_2))  # -> Geometry, Transform; disabled
curve_115 = Curve(scale_41.Geometry)  # disabled

end_points_16 = EndPoints(Curve=curve_113)  # -> Start, End; disabled
rectangle_2pt_16 = Rectangle2Pt(Plane=PlaneXY(0, 0, 0), PointA=end_points_16.Start, PointB=end_points_16.End, Radius=0)  # -> Rectangle, Length; disabled
curve_graph_mapper_10 = CurveGraphMapper(Curves=curve_113, Rectangle=rectangle_2pt_16.Rectangle, Values=series_19, Flip=False, Snap=True, TextSize=0.015625)  # -> Mapped, GraphCurves, GraphPoints, ValueLines, ValuePoints, MappedLines, MappedPoints, Boundary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; disabled
graphmapper_10 = GraphMapper(Curve=curve_113, Boundary=rectangle_2pt_16.Rectangle, Numbers=series_19, Input=bounds_17, Output=bounds_17, bobo=True)  # disabled
stream_filter_21 = StreamFilter(Gate=number_slider_2, Stream0=curve_graph_mapper_10.Mapped, Stream1=graphmapper_10)  # disabled

turtle_11 = DotNETVBScriptLEGACY(Forward=duplicate_data_11, Left=stream_filter_21)  # -> Output, Points; inputs Forward: list, Left: list; disabled; same code as turtle

expression_159 = Expression(O=turtle_11.Points, Expression="FORMAT(\"{0:R}\",O)")  # disabled
panel_260 = Panel(expression_159)  # disabled

point_20 = Point(turtle_11.Points)  # disabled
scale_42 = Scale(Geometry=point_20, Center=Point(0, 0, 0), Factor=expr("2^X", digit_scroller_91))  # -> Geometry, Transform; disabled

interpolate_t_11 = InterpolateT(Vertices=scale_42.Geometry, TangentStart=Vector(0.0625, 0, 0), TangentEnd=Vector(0, 0, 0), KnotStyle=2)  # -> Curve, Length, Domain; disabled
evaluate_length_63 = EvaluateLength(Curve=interpolate_t_11.Curve, Length=1, Normalized=True)  # -> Point, Tangent, Parameter; disabled
line_sdl_29 = LineSDL(Start=evaluate_length_63.Point, Direction=evaluate_length_63.Tangent, Length=1)  # disabled
mirror_16 = Mirror(Geometry=interpolate_t_11.Curve, Plane=line_sdl_29)  # -> Geometry, Transform; disabled
join_curves_17 = JoinCurves(Curves=[interpolate_t_11.Curve, mirror_16.Geometry], Preserve=False)  # disabled
evaluate_length_64 = EvaluateLength(Curve=join_curves_17, Length=1, Normalized=True)  # -> Point, Tangent, Parameter; disabled
rotate_11 = Rotate(Geometry=join_curves_17, Angle=3.141592654, Plane=evaluate_length_64.Point)  # -> Geometry, Transform; disabled
join_curves_18 = JoinCurves(Curves=[join_curves_17, rotate_11.Geometry], Preserve=False)  # disabled
curve_116 = Curve(join_curves_18)  # disabled

evaluate_length_65 = EvaluateLength(Curve=join_curves_18, Length=1, Normalized=True)  # -> Point, Tangent, Parameter; disabled
deconstruct_23 = Deconstruct(Point=evaluate_length_65.Point)  # -> XComponent, YComponent, ZComponent; disabled
expression_160 = Expression(O=deconstruct_23.YComponent, Expression="FORMAT(\"{0:R}\",O)")  # disabled
expression_161 = Expression(O=deconstruct_23.XComponent, Expression="FORMAT(\"{0:R}\",O)")  # disabled
expression_162 = Expression(O=deconstruct_23.ZComponent, Expression="FORMAT(\"{0:R}\",O)")  # disabled
panel_261 = Panel(expression_160)  # disabled
panel_262 = Panel(expression_161)  # disabled
panel_263 = Panel(expression_162)  # disabled
addition_12 = Addition(A=panel_261, B=panel_262)  # disabled
expression_163 = Expression(O=addition_12, Expression="FORMAT(\"{0:R}\",O)")  # disabled
panel_264 = Panel(expression_163)  # disabled
division_21 = Division(A=panel_264, B=2)  # disabled
expression_164 = Expression(O=division_21, Expression="FORMAT(\"{0:R}\",O)")  # disabled
panel_265 = Panel(expression_164)  # disabled
scale_43 = Scale(Geometry=scale_42.Geometry, Center=Point(0, 0, 0), Factor=expr("1/X", panel_265))  # -> Geometry, Transform; disabled
scale_44 = Scale(Geometry=curve_116, Center=Point(0, 0, 0), Factor=expr("1/X", panel_265))  # -> Geometry, Transform; disabled
evaluate_length_66 = EvaluateLength(Curve=scale_44.Geometry, Length=1, Normalized=True)  # -> Point, Tangent, Parameter; disabled
deconstruct_24 = Deconstruct(Point=evaluate_length_66.Point)  # -> XComponent, YComponent, ZComponent; disabled
expression_165 = Expression(O=deconstruct_24.YComponent, Expression="FORMAT(\"{0:R}\",O)")  # disabled
expression_166 = Expression(O=deconstruct_24.XComponent, Expression="FORMAT(\"{0:R}\",O)")  # disabled
expression_167 = Expression(O=deconstruct_24.ZComponent, Expression="FORMAT(\"{0:R}\",O)")  # disabled
panel_266 = Panel(expression_165)  # disabled
panel_267 = Panel(expression_166)  # disabled
panel_268 = Panel(expression_167)  # disabled
division_22 = Division(A=panel_262, B=panel_261)  # disabled
expression_168 = Expression(O=division_22, Expression="FORMAT(\"{0:R}\",O)")  # disabled
panel_269 = Panel(expression_168)  # disabled
curve_117 = Curve(scale_44.Geometry)  # disabled
point_21 = Point(scale_43.Geometry)  # disabled

curve_118 = Curve(curve_117)  # disabled

curve_119 = Curve(curve_118)  # disabled
curve_domain = CurveDomain(Curve=curve_119)  # -> Curve, Domain; disabled
deconstruct_domain_13 = DeconstructDomain(Domain=curve_domain.Domain)  # -> Start, End; disabled
construct_domain_9 = ConstructDomain(DomainStart=expr("X/2", deconstruct_domain_13.End), DomainEnd=deconstruct_domain_13.End)  # disabled
sub_curve = SubCurve(BaseCurve=curve_domain.Curve, Domain=construct_domain_9)  # disabled
move_26 = Move(Geometry=sub_curve, Motion=Vector(-0.5, -0.5, 0))  # -> Geometry, Transform; disabled
scale_45 = Scale(Geometry=move_26.Geometry, Center=Point(0, 0, 0), Factor=2)  # -> Geometry, Transform; disabled
curve_120 = Curve(scale_45.Geometry)  # disabled

curve_121 = Curve(curve_120)  # disabled
scale_46 = Scale(Geometry=curve_121, Center=Point(0, 0, 0), Factor=expr("2^X", number_12))  # -> Geometry, Transform; disabled
curve_curve = CurveCurve(CurveA=scale_46.Geometry, CurveB=scale_36.Geometry)  # -> flatten(Points), ParamsA, ParamsB; disabled
scale_47 = Scale(Geometry=curve_curve.Points, Center=Point(0, 0, 0), Factor=expr("1/2^X", number_12))  # -> Geometry, Transform; disabled
deconstruct_25 = Deconstruct(Point=scale_47.Geometry)  # -> expr("ABS(X)", graft(XComponent)), expr("ABS(X)", graft(YComponent)), expr("ABS(X)", graft(ZComponent)); disabled
construct_point_3 = ConstructPoint(XCoordinate=deconstruct_25.XComponent, YCoordinate=deconstruct_25.YComponent, ZCoordinate=deconstruct_25.ZComponent)  # disabled
list_length_18 = ListLength(List=scale_47.Geometry)  # disabled
panel_271 = Panel(list_length_18)  # disabled
construct_domain_10 = ConstructDomain(DomainStart=0, DomainEnd=expr("X-2", panel_271))  # disabled
range_9 = Range(Domain=construct_domain_10, Steps=expr("X-2", panel_271))  # disabled
list_item_16 = ListItem(List=flatten(construct_point_3), Index=range_9, Wrap=False)  # -> flatten(Item); disabled
rotate_12 = Rotate(Geometry=list_item_16, Angle=3.141592654, Plane=construct_point_2)  # -> reverse(flatten(Geometry)), Transform; disabled
merge = Merge(Data1=list_item_16, Data2=construct_point_2, Data3=rotate_12.Geometry)  # disabled
deconstruct_26 = Deconstruct(Point=merge)  # -> graft(XComponent), graft(YComponent), ZComponent; disabled
expression_169 = Expression(O=deconstruct_26.XComponent, Expression="FORMAT(\"{0:0.0000000000}\",O)")  # disabled
expression_170 = Expression(O=deconstruct_26.XComponent, Expression="FORMAT(\"{0:R}\",O)")  # disabled
data = Data(expression_169)  # disabled
panel_272 = Panel(data)  # disabled
expression_171 = Expression(O=deconstruct_26.YComponent, Expression="FORMAT(\"{0:0.00000000000000}\",O)")  # disabled
expression_172 = Expression(O=deconstruct_26.YComponent, Expression="FORMAT(\"{0:R}\",O)")  # disabled
data_2 = Data(expression_172)  # disabled
panel_273 = Panel(data_2)  # disabled
txtwriter_2 = VBScript(filePath=file_path_2, data=flatten(panel_273), activate=button_2)  # -> out, A; inputs data: list; disabled; same code as txtwriter

curve_122 = Curve(curve_120)  # disabled
divide_curve_6 = DivideCurve(Curve=curve_122, Count=number_33, Kinks=False)  # -> Points, Tangents, Parameters; disabled
deconstruct_27 = Deconstruct(Point=divide_curve_6.Points)  # -> graft(XComponent), graft(YComponent), ZComponent; disabled
expression_173 = Expression(Y=deconstruct_27.YComponent, Expression="FORMAT(\"{0:R}\",ROUND(Y, 15))")  # -> simplify(Result); disabled
expression_174 = Expression(X=deconstruct_27.XComponent, Expression="FORMAT(\"{0:R}\",ROUND(X, 15))")  # -> simplify(Result); disabled
expression_175 = Expression(X=deconstruct_27.XComponent, Expression="FORMAT(\"{0:R}\",X)")  # -> simplify(Result); disabled
panel_274 = Panel(expression_175)  # disabled
expression_176 = Expression(Y=deconstruct_27.YComponent, Expression="FORMAT(\"{0:R}\",Y)")  # -> simplify(Result); disabled
list_length_19 = ListLength(List=divide_curve_6.Points)  # disabled
duplicate_data_13 = DuplicateData(Data=",", Number=list_length_19, Order=True)  # -> simplify(graft(Data)); disabled
panel_275 = Panel(duplicate_data_13)  # disabled
panel_276 = Panel(expression_176)  # disabled
concatenate_2 = Concatenate(FragmentA=panel_274, FragmentB=panel_275, FragmentA_2=panel_276)  # -> flatten(Result); disabled
panel_277 = Panel(concatenate_2)  # disabled
txtwriter_3 = VBScript(filePath=file_path_3, data=flatten(panel_277), activate=button_3)  # -> out, A; inputs data: list; disabled; same code as txtwriter

move_27 = Move(Geometry=curve_117, Motion=vector_xyz_6.Vector)  # -> Geometry, Transform; disabled
mirror_17 = Mirror(Geometry=curve_117, Plane=PlaneYZ(0, 0, 0))  # -> Geometry, Transform; disabled
curve_123 = Curve(move_27.Geometry)  # disabled

number_36 = Number(expr("X*4", number_13))  # disabled
curve_124 = Curve(curve_120)  # disabled
evaluate_length_67 = EvaluateLength(Curve=curve_124, Length=flatten(1), Normalized=True)  # -> Point, Tangent, Parameter; disabled
yz_plane = YZPlane(Origin=evaluate_length_67.Point)  # disabled
mirror_18 = Mirror(Geometry=curve_124, Plane=yz_plane)  # -> Geometry, Transform; disabled
join_curves_19 = JoinCurves(Curves=[curve_124, mirror_18.Geometry], Preserve=False)  # disabled
linear_array = LinearArray(Geometry=join_curves_19, Direction=Vector(2, 0, 0), Count=2)  # -> Geometry, Transform; disabled
join_curves_20 = JoinCurves(Curves=linear_array.Geometry, Preserve=False)  # disabled
flip_curve = FlipCurve(Curve=join_curves_20)  # -> Curve, Flag; disabled
stream_filter_22 = StreamFilter(Gate=number_slider_23, Stream0=join_curves_20, Stream1=flip_curve.Curve)  # disabled
curve_domain_2 = CurveDomain(Curve=stream_filter_22)  # -> Curve, Domain; disabled
deconstruct_domain_14 = DeconstructDomain(Domain=curve_domain_2.Domain)  # -> Start, End; disabled
construct_domain_11 = ConstructDomain(DomainStart=expr("X/8", deconstruct_domain_14.End), DomainEnd=expr("X*5/8", deconstruct_domain_14.End))  # disabled
sub_curve_2 = SubCurve(BaseCurve=curve_domain_2.Curve, Domain=construct_domain_11)  # disabled
move_28 = Move(Geometry=sub_curve_2, Motion=Vector(-0.5, -0.5, 0))  # -> Geometry, Transform; disabled
scale_48 = Scale(Geometry=move_28.Geometry, Center=Point(0, 0, 0), Factor=0.5)  # -> Geometry, Transform; disabled
divide_curve_7 = DivideCurve(Curve=scale_48.Geometry, Count=number_36, Kinks=False)  # -> Points, Tangents, Parameters; disabled
deconstruct_28 = Deconstruct(Point=divide_curve_7.Points)  # -> simplify(graft(XComponent)), simplify(graft(YComponent)), ZComponent; disabled
expression_177 = Expression(X=deconstruct_28.XComponent, Expression="FORMAT(\"{0:R}\",X)")  # disabled
panel_278 = Panel(expression_177)  # disabled
expression_178 = Expression(Y=deconstruct_28.YComponent, Expression="FORMAT(\"{0:R}\",Y)")  # disabled
list_length_20 = ListLength(List=divide_curve_7.Points)  # disabled
duplicate_data_14 = DuplicateData(Data=";", Number=list_length_20, Order=True)  # -> simplify(graft(Data)); disabled
panel_279 = Panel(duplicate_data_14)  # disabled
panel_280 = Panel(expression_178)  # disabled
concatenate_3 = Concatenate(FragmentA=panel_278, FragmentB=panel_279, FragmentA_2=panel_280)  # -> flatten(Result); disabled
panel_281 = Panel(concatenate_3)  # disabled
txtwriter_4 = VBScript(filePath=file_path_4, data=flatten(panel_281), activate=button_4)  # -> out, A; inputs data: list; disabled; same code as txtwriter

end_points_17 = EndPoints(Curve=curve_115)  # -> Start, End; disabled
rectangle_2pt_17 = Rectangle2Pt(Plane=PlaneXY(0, 0, 0), PointA=end_points_17.Start, PointB=end_points_17.End, Radius=0)  # -> Rectangle, Length; disabled

number_37 = Number(number_14)  # disabled

series_21 = Series(Start=0, Step=panel_93, Count=number_37)  # disabled
expression_179 = Expression(O=series_21, Expression="FORMAT(\"{0:R}\",O)")  # disabled
panel_282 = Panel(expression_179)  # disabled
bounds_19 = Bounds(Numbers=series_21)  # disabled
expression_180 = Expression(X=number_37, Expression="1/X")  # disabled
duplicate_data_15 = DuplicateData(Data=expression_180, Number=number_37, Order=True)  # disabled

curve_graph_mapper_11 = CurveGraphMapper(Curves=curve_115, Rectangle=rectangle_2pt_17.Rectangle, Values=series_21, Flip=False, Snap=True, TextSize=0.015625)  # -> Mapped, GraphCurves, GraphPoints, ValueLines, ValuePoints, MappedLines, MappedPoints, Boundary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; disabled
graphmapper_11 = GraphMapper(Curve=curve_115, Boundary=rectangle_2pt_17.Rectangle, Numbers=series_21, Input=bounds_19, Output=bounds_19, bobo=False)  # disabled
stream_filter_23 = StreamFilter(Gate=number_slider_2, Stream0=curve_graph_mapper_11.Mapped, Stream1=graphmapper_11)  # disabled

turtle_12 = DotNETVBScriptLEGACY(Forward=duplicate_data_15, Left=stream_filter_23)  # -> Output, Points; inputs Forward: list, Left: list; disabled; same code as turtle

expression_181 = Expression(O=turtle_12.Points, Expression="FORMAT(\"{0:R}\",O)")  # disabled
panel_283 = Panel(expression_181)  # disabled

point_22 = Point(turtle_12.Points)  # disabled
scale_49 = Scale(Geometry=point_22, Center=Point(0, 0, 0), Factor=expr("2^X", digit_scroller_95))  # -> Geometry, Transform; disabled

interpolate_t_12 = InterpolateT(Vertices=scale_49.Geometry, TangentStart=Vector(0.0625, 0, 0), TangentEnd=Vector(0, 0, 0), KnotStyle=2)  # -> Curve, Length, Domain; disabled
evaluate_length_68 = EvaluateLength(Curve=interpolate_t_12.Curve, Length=1, Normalized=True)  # -> Point, Tangent, Parameter; disabled
line_sdl_30 = LineSDL(Start=evaluate_length_68.Point, Direction=evaluate_length_68.Tangent, Length=1)  # disabled
mirror_19 = Mirror(Geometry=interpolate_t_12.Curve, Plane=line_sdl_30)  # -> Geometry, Transform; disabled
join_curves_21 = JoinCurves(Curves=[interpolate_t_12.Curve, mirror_19.Geometry], Preserve=False)  # disabled
evaluate_length_69 = EvaluateLength(Curve=join_curves_21, Length=1, Normalized=True)  # -> Point, Tangent, Parameter; disabled
rotate_13 = Rotate(Geometry=join_curves_21, Angle=3.141592654, Plane=evaluate_length_69.Point)  # -> Geometry, Transform; disabled
join_curves_22 = JoinCurves(Curves=[join_curves_21, rotate_13.Geometry], Preserve=False)  # disabled
curve_125 = Curve(join_curves_22)  # disabled

evaluate_length_70 = EvaluateLength(Curve=join_curves_22, Length=1, Normalized=True)  # -> Point, Tangent, Parameter; disabled
deconstruct_29 = Deconstruct(Point=evaluate_length_70.Point)  # -> XComponent, YComponent, ZComponent; disabled
expression_182 = Expression(O=deconstruct_29.YComponent, Expression="FORMAT(\"{0:R}\",O)")  # disabled
expression_183 = Expression(O=deconstruct_29.XComponent, Expression="FORMAT(\"{0:R}\",O)")  # disabled
expression_184 = Expression(O=deconstruct_29.ZComponent, Expression="FORMAT(\"{0:R}\",O)")  # disabled
panel_284 = Panel(expression_182)  # disabled
panel_285 = Panel(expression_183)  # disabled
panel_286 = Panel(expression_184)  # disabled
addition_13 = Addition(A=panel_284, B=panel_285)  # disabled
expression_185 = Expression(O=addition_13, Expression="FORMAT(\"{0:R}\",O)")  # disabled
panel_287 = Panel(expression_185)  # disabled
division_23 = Division(A=panel_287, B=2)  # disabled
expression_186 = Expression(O=division_23, Expression="FORMAT(\"{0:R}\",O)")  # disabled
panel_288 = Panel(expression_186)  # disabled
scale_50 = Scale(Geometry=scale_49.Geometry, Center=Point(0, 0, 0), Factor=expr("1/X", panel_288))  # -> Geometry, Transform; disabled
scale_51 = Scale(Geometry=curve_125, Center=Point(0, 0, 0), Factor=expr("1/X", panel_288))  # -> Geometry, Transform; disabled
evaluate_length_71 = EvaluateLength(Curve=scale_51.Geometry, Length=1, Normalized=True)  # -> Point, Tangent, Parameter; disabled
deconstruct_30 = Deconstruct(Point=evaluate_length_71.Point)  # -> XComponent, YComponent, ZComponent; disabled
expression_187 = Expression(O=deconstruct_30.YComponent, Expression="FORMAT(\"{0:R}\",O)")  # disabled
expression_188 = Expression(O=deconstruct_30.XComponent, Expression="FORMAT(\"{0:R}\",O)")  # disabled
expression_189 = Expression(O=deconstruct_30.ZComponent, Expression="FORMAT(\"{0:R}\",O)")  # disabled
panel_289 = Panel(expression_187)  # disabled
panel_290 = Panel(expression_188)  # disabled
panel_291 = Panel(expression_189)  # disabled
division_24 = Division(A=panel_285, B=panel_284)  # disabled
expression_190 = Expression(O=division_24, Expression="FORMAT(\"{0:R}\",O)")  # disabled
panel_292 = Panel(expression_190)  # disabled
curve_126 = Curve(scale_51.Geometry)  # disabled
point_23 = Point(scale_50.Geometry)  # disabled

move_29 = Move(Geometry=curve_126, Motion=Vector(12.5, 0, 0))  # -> Geometry, Transform; disabled
mirror_20 = Mirror(Geometry=curve_126, Plane=PlaneYZ(0, 0, 0))  # -> Geometry, Transform; disabled
curve_127 = Curve(move_29.Geometry)  # disabled

vector_xyz_17 = VectorXYZ(XComponent=12.5, YComponent=1.5, ZComponent=0)  # -> Vector, Length; disabled
curve_128 = Curve(curve_126)  # disabled
end_points_18 = EndPoints(Curve=curve_128)  # -> Start, End; disabled
rectangle_2pt_18 = Rectangle2Pt(Plane=PlaneXY(0, 0, 0), PointA=end_points_18.Start, PointB=end_points_18.End, Radius=0)  # -> Rectangle, Length; disabled
deconstuct_rectangle_7 = DeconstuctRectangle(Rectangle=rectangle_2pt_18.Rectangle)  # -> BasePlane, XInterval, YInterval; disabled
deconstruct_domain_15 = DeconstructDomain(Domain=deconstuct_rectangle_7.YInterval)  # -> Start, End; disabled
deconstruct_domain_16 = DeconstructDomain(Domain=deconstuct_rectangle_7.XInterval)  # -> Start, End; disabled
scale_nu_8 = ScaleNU(
    Geometry=curve_126,
    Plane=PlaneXY(0, 0, 0),
    ScaleX=expr("1/X", deconstruct_domain_16.End),
    ScaleY=expr("1/X", deconstruct_domain_15.End),
    ScaleZ=1)  # -> Geometry, Transform; disabled
curve_129 = Curve(scale_nu_8.Geometry)  # disabled
move_30 = Move(Geometry=curve_129, Motion=vector_xyz_17.Vector)  # -> Geometry, Transform; disabled
curve_130 = Curve(move_30.Geometry)  # disabled

digit_scroller_98 = DigitScroller(Scroller_Digits=12, Scroller_Prefix=" ", Scroller_Radix=2, Scroller_Value=0)  # disabled
stream_filter_24 = StreamFilter(Gate=number_slider, Stream0=curve_126, Stream1=curve_129)  # disabled
curve_131 = Curve(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)  # disabled
curve_132 = Curve(stream_filter_24)  # disabled
scale_52 = Scale(Geometry=curve_132, Center=Point(0, 0, 0), Factor=expr("2^X", number_2))  # -> Geometry, Transform; disabled
curve_133 = Curve(scale_52.Geometry)  # disabled
curve_134 = Curve(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)  # disabled

digit_scroller_99 = DigitScroller(Scroller_Digits=12, Scroller_Prefix="Digit Scroller", Scroller_Radix=1, Scroller_Value=0.00140149998)  # disabled
number_slider_26 = Slider(256, range=0..65536)  # disabled
radians_13 = Radians(Degrees=number)  # disabled

expression_191 = Expression(O=radians_13, Expression="FORMAT(\"{0:0.00000000000000000000}\",O)")  # disabled
panel_298 = Panel(expression_191)  # disabled
curve_135 = Curve(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)  # disabled
number_38 = Number(number_14)  # disabled

digit_scroller_100 = DigitScroller(Scroller_Digits=12, Scroller_Prefix=" ", Scroller_Radix=7, Scroller_Value=16)  # disabled

number_slider_27 = Slider(1, range=0..1)  # disabled
end_points_19 = EndPoints(Curve=curve_133)  # -> Start, End; disabled
rectangle_2pt_19 = Rectangle2Pt(Plane=PlaneXY(0, 0, 0), PointA=end_points_19.Start, PointB=end_points_19.End, Radius=0)  # -> Rectangle, Length; disabled

series_22 = Series(Start=0, Step=panel_298, Count=number_38)  # disabled
expression_192 = Expression(O=series_22, Expression="FORMAT(\"{0:R}\",O)")  # disabled
panel_299 = Panel(expression_192)  # disabled
bounds_20 = Bounds(Numbers=series_22)  # disabled
expression_193 = Expression(X=number_38, Expression="1/X")  # disabled
duplicate_data_16 = DuplicateData(Data=expression_193, Number=number_38, Order=True)  # disabled

curve_graph_mapper_12 = CurveGraphMapper(Curves=curve_133, Rectangle=rectangle_2pt_19.Rectangle, Values=series_22, Flip=False, Snap=True, TextSize=0.015625)  # -> Mapped, GraphCurves, GraphPoints, ValueLines, ValuePoints, MappedLines, MappedPoints, Boundary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; disabled
graphmapper_12 = GraphMapper(Curve=curve_133, Boundary=rectangle_2pt_19.Rectangle, Numbers=series_22, Input=bounds_20, Output=bounds_20, bobo=False)  # disabled
stream_filter_25 = StreamFilter(Gate=number_slider_2, Stream0=curve_graph_mapper_12.Mapped, Stream1=graphmapper_12)  # disabled

turtle_13 = DotNETVBScriptLEGACY(Forward=duplicate_data_16, Left=stream_filter_25)  # -> Output, Points; inputs Forward: list, Left: list; disabled; same code as turtle

expression_194 = Expression(O=turtle_13.Points, Expression="FORMAT(\"{0:R}\",O)")  # disabled
panel_300 = Panel(expression_194)  # disabled

point_24 = Point(turtle_13.Points)  # disabled
scale_53 = Scale(Geometry=point_24, Center=Point(0, 0, 0), Factor=expr("2^X", digit_scroller_100))  # -> Geometry, Transform; disabled

interpolate_t_13 = InterpolateT(Vertices=scale_53.Geometry, TangentStart=Vector(0.0625, 0, 0), TangentEnd=Vector(0, 0, 0), KnotStyle=2)  # -> Curve, Length, Domain; disabled
evaluate_length_72 = EvaluateLength(Curve=interpolate_t_13.Curve, Length=1, Normalized=True)  # -> Point, Tangent, Parameter; disabled
line_sdl_31 = LineSDL(Start=evaluate_length_72.Point, Direction=evaluate_length_72.Tangent, Length=1)  # disabled
mirror_21 = Mirror(Geometry=interpolate_t_13.Curve, Plane=line_sdl_31)  # -> Geometry, Transform; disabled
join_curves_23 = JoinCurves(Curves=[interpolate_t_13.Curve, mirror_21.Geometry], Preserve=False)  # disabled
evaluate_length_73 = EvaluateLength(Curve=join_curves_23, Length=1, Normalized=True)  # -> Point, Tangent, Parameter; disabled
rotate_14 = Rotate(Geometry=join_curves_23, Angle=3.141592654, Plane=evaluate_length_73.Point)  # -> Geometry, Transform; disabled
join_curves_24 = JoinCurves(Curves=[join_curves_23, rotate_14.Geometry], Preserve=False)  # disabled
curve_136 = Curve(join_curves_24)  # disabled

evaluate_length_74 = EvaluateLength(Curve=join_curves_24, Length=1, Normalized=True)  # -> Point, Tangent, Parameter; disabled
deconstruct_31 = Deconstruct(Point=evaluate_length_74.Point)  # -> XComponent, YComponent, ZComponent; disabled
expression_195 = Expression(O=deconstruct_31.YComponent, Expression="FORMAT(\"{0:R}\",O)")  # disabled
expression_196 = Expression(O=deconstruct_31.XComponent, Expression="FORMAT(\"{0:R}\",O)")  # disabled
expression_197 = Expression(O=deconstruct_31.ZComponent, Expression="FORMAT(\"{0:R}\",O)")  # disabled
panel_301 = Panel(expression_195)  # disabled
panel_302 = Panel(expression_196)  # disabled
panel_303 = Panel(expression_197)  # disabled
addition_14 = Addition(A=panel_301, B=panel_302)  # disabled
expression_198 = Expression(O=addition_14, Expression="FORMAT(\"{0:R}\",O)")  # disabled
panel_304 = Panel(expression_198)  # disabled
division_25 = Division(A=panel_304, B=2)  # disabled
expression_199 = Expression(O=division_25, Expression="FORMAT(\"{0:R}\",O)")  # disabled
panel_305 = Panel(expression_199)  # disabled
scale_54 = Scale(Geometry=scale_53.Geometry, Center=Point(0, 0, 0), Factor=expr("1/X", panel_305))  # -> Geometry, Transform; disabled
scale_55 = Scale(Geometry=curve_136, Center=Point(0, 0, 0), Factor=expr("1/X", panel_305))  # -> Geometry, Transform; disabled
evaluate_length_75 = EvaluateLength(Curve=scale_55.Geometry, Length=1, Normalized=True)  # -> Point, Tangent, Parameter; disabled
deconstruct_32 = Deconstruct(Point=evaluate_length_75.Point)  # -> XComponent, YComponent, ZComponent; disabled
expression_200 = Expression(O=deconstruct_32.YComponent, Expression="FORMAT(\"{0:R}\",O)")  # disabled
expression_201 = Expression(O=deconstruct_32.XComponent, Expression="FORMAT(\"{0:R}\",O)")  # disabled
expression_202 = Expression(O=deconstruct_32.ZComponent, Expression="FORMAT(\"{0:R}\",O)")  # disabled
panel_306 = Panel(expression_200)  # disabled
panel_307 = Panel(expression_201)  # disabled
panel_308 = Panel(expression_202)  # disabled
division_26 = Division(A=panel_302, B=panel_301)  # disabled
expression_203 = Expression(O=division_26, Expression="FORMAT(\"{0:R}\",O)")  # disabled
panel_309 = Panel(expression_203)  # disabled
curve_137 = Curve(scale_55.Geometry)  # disabled
point_25 = Point(scale_54.Geometry)  # disabled

move_31 = Move(Geometry=curve_137, Motion=Vector(15, 0, 0))  # -> Geometry, Transform; disabled
mirror_22 = Mirror(Geometry=curve_137, Plane=PlaneYZ(0, 0, 0))  # -> Geometry, Transform; disabled
curve_138 = Curve(move_31.Geometry)  # disabled

vector_xyz_18 = VectorXYZ(XComponent=15, YComponent=1.5, ZComponent=0)  # -> Vector, Length; disabled
curve_139 = Curve(curve_137)  # disabled
end_points_20 = EndPoints(Curve=curve_139)  # -> Start, End; disabled
rectangle_2pt_20 = Rectangle2Pt(Plane=PlaneXY(0, 0, 0), PointA=end_points_20.Start, PointB=end_points_20.End, Radius=0)  # -> Rectangle, Length; disabled
deconstuct_rectangle_8 = DeconstuctRectangle(Rectangle=rectangle_2pt_20.Rectangle)  # -> BasePlane, XInterval, YInterval; disabled
deconstruct_domain_17 = DeconstructDomain(Domain=deconstuct_rectangle_8.YInterval)  # -> Start, End; disabled
deconstruct_domain_18 = DeconstructDomain(Domain=deconstuct_rectangle_8.XInterval)  # -> Start, End; disabled
scale_nu_9 = ScaleNU(
    Geometry=curve_137,
    Plane=PlaneXY(0, 0, 0),
    ScaleX=expr("1/X", deconstruct_domain_18.End),
    ScaleY=expr("1/X", deconstruct_domain_17.End),
    ScaleZ=1)  # -> Geometry, Transform; disabled
curve_140 = Curve(scale_nu_9.Geometry)  # disabled
move_32 = Move(Geometry=curve_140, Motion=vector_xyz_18.Vector)  # -> Geometry, Transform; disabled
curve_141 = Curve(move_32.Geometry)  # disabled

digit_scroller_101 = DigitScroller(Scroller_Digits=12, Scroller_Prefix=" ", Scroller_Radix=2, Scroller_Value=0)  # disabled
stream_filter_26 = StreamFilter(Gate=number_slider, Stream0=curve_137, Stream1=curve_140)  # disabled
curve_142 = Curve(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)  # disabled
curve_143 = Curve(stream_filter_26)  # disabled
scale_56 = Scale(Geometry=curve_143, Center=Point(0, 0, 0), Factor=expr("2^X", number_2))  # -> Geometry, Transform; disabled
curve_144 = Curve(scale_56.Geometry)  # disabled
curve_145 = Curve(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)  # disabled

digit_scroller_102 = DigitScroller(Scroller_Digits=12, Scroller_Prefix="Digit Scroller", Scroller_Radix=1, Scroller_Value=0.00140149998)  # disabled
number_slider_28 = Slider(256, range=0..65536)  # disabled
radians_14 = Radians(Degrees=number)  # disabled

expression_204 = Expression(O=radians_14, Expression="FORMAT(\"{0:0.00000000000000000000}\",O)")  # disabled
panel_315 = Panel(expression_204)  # disabled
curve_146 = Curve(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)  # disabled
number_39 = Number(number_14)  # disabled

digit_scroller_103 = DigitScroller(Scroller_Digits=12, Scroller_Prefix=" ", Scroller_Radix=7, Scroller_Value=16)  # disabled

number_slider_29 = Slider(1, range=0..1)  # disabled
end_points_21 = EndPoints(Curve=curve_144)  # -> Start, End; disabled
rectangle_2pt_21 = Rectangle2Pt(Plane=PlaneXY(0, 0, 0), PointA=end_points_21.Start, PointB=end_points_21.End, Radius=0)  # -> Rectangle, Length; disabled

series_23 = Series(Start=0, Step=panel_315, Count=number_39)  # disabled
expression_205 = Expression(O=series_23, Expression="FORMAT(\"{0:R}\",O)")  # disabled
panel_316 = Panel(expression_205)  # disabled
bounds_21 = Bounds(Numbers=series_23)  # disabled
expression_206 = Expression(X=number_39, Expression="1/X")  # disabled
duplicate_data_17 = DuplicateData(Data=expression_206, Number=number_39, Order=True)  # disabled

curve_graph_mapper_13 = CurveGraphMapper(Curves=curve_144, Rectangle=rectangle_2pt_21.Rectangle, Values=series_23, Flip=False, Snap=True, TextSize=0.015625)  # -> Mapped, GraphCurves, GraphPoints, ValueLines, ValuePoints, MappedLines, MappedPoints, Boundary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; disabled
graphmapper_13 = GraphMapper(Curve=curve_144, Boundary=rectangle_2pt_21.Rectangle, Numbers=series_23, Input=bounds_21, Output=bounds_21, bobo=False)  # disabled
stream_filter_27 = StreamFilter(Gate=number_slider_2, Stream0=curve_graph_mapper_13.Mapped, Stream1=graphmapper_13)  # disabled

turtle_14 = DotNETVBScriptLEGACY(Forward=duplicate_data_17, Left=stream_filter_27)  # -> Output, Points; inputs Forward: list, Left: list; disabled; same code as turtle

expression_207 = Expression(O=turtle_14.Points, Expression="FORMAT(\"{0:R}\",O)")  # disabled
panel_317 = Panel(expression_207)  # disabled

point_26 = Point(turtle_14.Points)  # disabled
scale_57 = Scale(Geometry=point_26, Center=Point(0, 0, 0), Factor=expr("2^X", digit_scroller_103))  # -> Geometry, Transform; disabled

interpolate_t_14 = InterpolateT(Vertices=scale_57.Geometry, TangentStart=Vector(0.0625, 0, 0), TangentEnd=Vector(0, 0, 0), KnotStyle=2)  # -> Curve, Length, Domain; disabled
evaluate_length_76 = EvaluateLength(Curve=interpolate_t_14.Curve, Length=1, Normalized=True)  # -> Point, Tangent, Parameter; disabled
line_sdl_32 = LineSDL(Start=evaluate_length_76.Point, Direction=evaluate_length_76.Tangent, Length=1)  # disabled
mirror_23 = Mirror(Geometry=interpolate_t_14.Curve, Plane=line_sdl_32)  # -> Geometry, Transform; disabled
join_curves_25 = JoinCurves(Curves=[interpolate_t_14.Curve, mirror_23.Geometry], Preserve=False)  # disabled
evaluate_length_77 = EvaluateLength(Curve=join_curves_25, Length=1, Normalized=True)  # -> Point, Tangent, Parameter; disabled
rotate_15 = Rotate(Geometry=join_curves_25, Angle=3.141592654, Plane=evaluate_length_77.Point)  # -> Geometry, Transform; disabled
join_curves_26 = JoinCurves(Curves=[join_curves_25, rotate_15.Geometry], Preserve=False)  # disabled
curve_147 = Curve(join_curves_26)  # disabled

evaluate_length_78 = EvaluateLength(Curve=join_curves_26, Length=1, Normalized=True)  # -> Point, Tangent, Parameter; disabled
deconstruct_33 = Deconstruct(Point=evaluate_length_78.Point)  # -> XComponent, YComponent, ZComponent; disabled
expression_208 = Expression(O=deconstruct_33.YComponent, Expression="FORMAT(\"{0:R}\",O)")  # disabled
expression_209 = Expression(O=deconstruct_33.XComponent, Expression="FORMAT(\"{0:R}\",O)")  # disabled
expression_210 = Expression(O=deconstruct_33.ZComponent, Expression="FORMAT(\"{0:R}\",O)")  # disabled
panel_318 = Panel(expression_208)  # disabled
panel_319 = Panel(expression_209)  # disabled
panel_320 = Panel(expression_210)  # disabled
addition_15 = Addition(A=panel_318, B=panel_319)  # disabled
expression_211 = Expression(O=addition_15, Expression="FORMAT(\"{0:R}\",O)")  # disabled
panel_321 = Panel(expression_211)  # disabled
division_27 = Division(A=panel_321, B=2)  # disabled
expression_212 = Expression(O=division_27, Expression="FORMAT(\"{0:R}\",O)")  # disabled
panel_322 = Panel(expression_212)  # disabled
scale_58 = Scale(Geometry=scale_57.Geometry, Center=Point(0, 0, 0), Factor=expr("1/X", panel_322))  # -> Geometry, Transform; disabled
scale_59 = Scale(Geometry=curve_147, Center=Point(0, 0, 0), Factor=expr("1/X", panel_322))  # -> Geometry, Transform; disabled
evaluate_length_79 = EvaluateLength(Curve=scale_59.Geometry, Length=1, Normalized=True)  # -> Point, Tangent, Parameter; disabled
deconstruct_34 = Deconstruct(Point=evaluate_length_79.Point)  # -> XComponent, YComponent, ZComponent; disabled
expression_213 = Expression(O=deconstruct_34.YComponent, Expression="FORMAT(\"{0:R}\",O)")  # disabled
expression_214 = Expression(O=deconstruct_34.XComponent, Expression="FORMAT(\"{0:R}\",O)")  # disabled
expression_215 = Expression(O=deconstruct_34.ZComponent, Expression="FORMAT(\"{0:R}\",O)")  # disabled
panel_323 = Panel(expression_213)  # disabled
panel_324 = Panel(expression_214)  # disabled
panel_325 = Panel(expression_215)  # disabled
division_28 = Division(A=panel_319, B=panel_318)  # disabled
expression_216 = Expression(O=division_28, Expression="FORMAT(\"{0:R}\",O)")  # disabled
panel_326 = Panel(expression_216)  # disabled
curve_148 = Curve(scale_59.Geometry)  # disabled
point_27 = Point(scale_58.Geometry)  # disabled

move_33 = Move(Geometry=curve_148, Motion=Vector(17.5, 0, 0))  # -> Geometry, Transform; disabled
mirror_24 = Mirror(Geometry=curve_148, Plane=PlaneYZ(0, 0, 0))  # -> Geometry, Transform; disabled
curve_149 = Curve(move_33.Geometry)  # disabled

entwine = Entwine(
    Branch0X=curve_41,
    Branch1X=curve_54,
    Branch3X=curve_95,
    Branch4X=curve_108,
    Branch5X=curve_127,
    Branch6X=curve_138,
    Branch7X=curve_149,
    FlattenInputs=False)

vector_xyz_19 = VectorXYZ(XComponent=17.5, YComponent=1.5, ZComponent=0)  # -> Vector, Length; disabled
curve_150 = Curve(curve_148)  # disabled
end_points_22 = EndPoints(Curve=curve_150)  # -> Start, End; disabled
rectangle_2pt_22 = Rectangle2Pt(Plane=PlaneXY(0, 0, 0), PointA=end_points_22.Start, PointB=end_points_22.End, Radius=0)  # -> Rectangle, Length; disabled
deconstuct_rectangle_9 = DeconstuctRectangle(Rectangle=rectangle_2pt_22.Rectangle)  # -> BasePlane, XInterval, YInterval; disabled
deconstruct_domain_19 = DeconstructDomain(Domain=deconstuct_rectangle_9.YInterval)  # -> Start, End; disabled
deconstruct_domain_20 = DeconstructDomain(Domain=deconstuct_rectangle_9.XInterval)  # -> Start, End; disabled
scale_nu_10 = ScaleNU(
    Geometry=curve_148,
    Plane=PlaneXY(0, 0, 0),
    ScaleX=expr("1/X", deconstruct_domain_20.End),
    ScaleY=expr("1/X", deconstruct_domain_19.End),
    ScaleZ=1)  # -> Geometry, Transform; disabled
curve_151 = Curve(scale_nu_10.Geometry)  # disabled
move_34 = Move(Geometry=curve_151, Motion=vector_xyz_19.Vector)  # -> Geometry, Transform; disabled
curve_152 = Curve(move_34.Geometry)  # disabled

entwine_2 = Entwine(
    Branch0X=curve_46,
    Branch1X=curve_57,
    Branch3X=curve_98,
    Branch4X=curve_111,
    Branch5X=curve_130,
    Branch6X=curve_141,
    Branch7X=curve_152,
    FlattenInputs=False)
entwine_3 = Entwine(Branch0X=entwine_2, Branch1X=entwine, FlattenInputs=False)

digit_scroller_104 = DigitScroller(Scroller_Digits=12, Scroller_Prefix=" ", Scroller_Radix=2, Scroller_Value=30.9312132)  # disabled
stream_filter_28 = StreamFilter(Gate=number_slider, Stream0=curve_148, Stream1=curve_151)  # disabled
curve_153 = Curve(stream_filter_28)  # disabled
scale_60 = Scale(Geometry=curve_153, Center=Point(0, 0, 0), Factor=expr("2^X", number_2))  # -> Geometry, Transform; disabled
curve_154 = Curve(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)  # disabled
curve_155 = Curve(scale_60.Geometry)  # disabled
curve_156 = Curve(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)  # disabled

digit_scroller_105 = DigitScroller(Scroller_Digits=12, Scroller_Prefix="Digit Scroller", Scroller_Radix=1, Scroller_Value=0.00140149998)  # disabled
radians_15 = Radians(Degrees=digit_scroller_96)  # disabled
number_slider_30 = Slider(256, range=0..65536)  # disabled

expression_217 = Expression(O=radians_15, Expression="FORMAT(\"{0:0.00000000000000000000}\",O)")  # disabled
panel_331 = Panel(expression_217)  # disabled
curve_157 = Curve(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)  # disabled
number_40 = Number(number_14)  # disabled

digit_scroller_106 = DigitScroller(Scroller_Digits=12, Scroller_Prefix=" ", Scroller_Radix=7, Scroller_Value=16)  # disabled

deconstruct_vector = DeconstructVector(Vector=vector_xyz_19.Vector)  # -> XComponent, YComponent, ZComponent; disabled
vector_xyz_20 = VectorXYZ(
    XComponent=deconstruct_vector.XComponent,
    YComponent=expr("X+2.5", deconstruct_vector.YComponent),
    ZComponent=deconstruct_vector.ZComponent)  # -> Vector, Length; disabled

number_slider_31 = Slider(1, range=0..1)  # disabled
end_points_23 = EndPoints(Curve=curve_155)  # -> Start, End; disabled
rectangle_2pt_23 = Rectangle2Pt(Plane=PlaneXY(0, 0, 0), PointA=end_points_23.Start, PointB=end_points_23.End, Radius=0)  # -> Rectangle, Length; disabled

series_24 = Series(Start=0, Step=panel_331, Count=number_40)  # disabled
expression_218 = Expression(O=series_24, Expression="FORMAT(\"{0:R}\",O)")  # disabled
panel_332 = Panel(expression_218)  # disabled
bounds_22 = Bounds(Numbers=series_24)  # disabled
expression_219 = Expression(X=number_40, Expression="1/X")  # disabled
duplicate_data_18 = DuplicateData(Data=expression_219, Number=number_40, Order=True)  # disabled

curve_graph_mapper_14 = CurveGraphMapper(Curves=curve_155, Rectangle=rectangle_2pt_23.Rectangle, Values=series_24, Flip=False, Snap=True, TextSize=0.015625)  # -> Mapped, GraphCurves, GraphPoints, ValueLines, ValuePoints, MappedLines, MappedPoints, Boundary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; disabled
graphmapper_14 = GraphMapper(Curve=curve_155, Boundary=rectangle_2pt_23.Rectangle, Numbers=series_24, Input=bounds_22, Output=bounds_22, bobo=False)  # disabled
stream_filter_29 = StreamFilter(Gate=number_slider_2, Stream0=curve_graph_mapper_14.Mapped, Stream1=graphmapper_14)  # disabled

turtle_15 = DotNETVBScriptLEGACY(Forward=duplicate_data_18, Left=stream_filter_29)  # -> Output, Points; inputs Forward: list, Left: list; disabled; same code as turtle

expression_220 = Expression(O=turtle_15.Points, Expression="FORMAT(\"{0:R}\",O)")  # disabled
panel_333 = Panel(expression_220)  # disabled

point_28 = Point(turtle_15.Points)  # disabled
scale_61 = Scale(Geometry=point_28, Center=Point(0, 0, 0), Factor=expr("2^X", digit_scroller_106))  # -> Geometry, Transform; disabled

interpolate_t_15 = InterpolateT(Vertices=scale_61.Geometry, TangentStart=Vector(0.0625, 0, 0), TangentEnd=Vector(0, 0, 0), KnotStyle=2)  # -> Curve, Length, Domain; disabled
evaluate_length_80 = EvaluateLength(Curve=interpolate_t_15.Curve, Length=1, Normalized=True)  # -> Point, Tangent, Parameter; disabled
line_sdl_33 = LineSDL(Start=evaluate_length_80.Point, Direction=evaluate_length_80.Tangent, Length=1)  # disabled
mirror_25 = Mirror(Geometry=interpolate_t_15.Curve, Plane=line_sdl_33)  # -> Geometry, Transform; disabled
join_curves_27 = JoinCurves(Curves=[interpolate_t_15.Curve, mirror_25.Geometry], Preserve=False)  # disabled
evaluate_length_81 = EvaluateLength(Curve=join_curves_27, Length=1, Normalized=True)  # -> Point, Tangent, Parameter; disabled
rotate_16 = Rotate(Geometry=join_curves_27, Angle=3.141592654, Plane=evaluate_length_81.Point)  # -> Geometry, Transform; disabled
join_curves_28 = JoinCurves(Curves=[join_curves_27, rotate_16.Geometry], Preserve=False)  # disabled
curve_158 = Curve(join_curves_28)  # disabled

evaluate_length_82 = EvaluateLength(Curve=join_curves_28, Length=1, Normalized=True)  # -> Point, Tangent, Parameter; disabled
deconstruct_35 = Deconstruct(Point=evaluate_length_82.Point)  # -> XComponent, YComponent, ZComponent; disabled
expression_221 = Expression(O=deconstruct_35.YComponent, Expression="FORMAT(\"{0:R}\",O)")  # disabled
expression_222 = Expression(O=deconstruct_35.XComponent, Expression="FORMAT(\"{0:R}\",O)")  # disabled
expression_223 = Expression(O=deconstruct_35.ZComponent, Expression="FORMAT(\"{0:R}\",O)")  # disabled
panel_334 = Panel(expression_221)  # disabled
panel_335 = Panel(expression_222)  # disabled
panel_336 = Panel(expression_223)  # disabled
addition_16 = Addition(A=panel_334, B=panel_335)  # disabled
expression_224 = Expression(O=addition_16, Expression="FORMAT(\"{0:R}\",O)")  # disabled
panel_337 = Panel(expression_224)  # disabled
division_29 = Division(A=panel_337, B=2)  # disabled
expression_225 = Expression(O=division_29, Expression="FORMAT(\"{0:R}\",O)")  # disabled
panel_338 = Panel(expression_225)  # disabled
scale_62 = Scale(Geometry=scale_61.Geometry, Center=Point(0, 0, 0), Factor=expr("1/X", panel_338))  # -> Geometry, Transform; disabled
scale_63 = Scale(Geometry=curve_158, Center=Point(0, 0, 0), Factor=expr("1/X", panel_338))  # -> Geometry, Transform; disabled
evaluate_length_83 = EvaluateLength(Curve=scale_63.Geometry, Length=1, Normalized=True)  # -> Point, Tangent, Parameter; disabled
deconstruct_36 = Deconstruct(Point=evaluate_length_83.Point)  # -> XComponent, YComponent, ZComponent; disabled
expression_226 = Expression(O=deconstruct_36.YComponent, Expression="FORMAT(\"{0:R}\",O)")  # disabled
expression_227 = Expression(O=deconstruct_36.XComponent, Expression="FORMAT(\"{0:R}\",O)")  # disabled
expression_228 = Expression(O=deconstruct_36.ZComponent, Expression="FORMAT(\"{0:R}\",O)")  # disabled
panel_339 = Panel(expression_226)  # disabled
panel_340 = Panel(expression_227)  # disabled
panel_341 = Panel(expression_228)  # disabled
division_30 = Division(A=panel_335, B=panel_334)  # disabled
expression_229 = Expression(O=division_30, Expression="FORMAT(\"{0:R}\",O)")  # disabled
panel_342 = Panel(expression_229)  # disabled
curve_159 = Curve(scale_63.Geometry)  # disabled
point_29 = Point(scale_62.Geometry)  # disabled

move_35 = Move(Geometry=curve_159, Motion=vector_xyz_20.Vector)  # -> Geometry, Transform; disabled
mirror_26 = Mirror(Geometry=curve_159, Plane=PlaneYZ(0, 0, 0))  # -> Geometry, Transform; disabled
curve_160 = Curve(move_35.Geometry)  # disabled

entwine_4 = Entwine(
    Branch0X=curve_160,
    Branch1X=curve_51,
    Branch2X=curve_64,
    Branch3X=curve_92,
    Branch4X=curve_105,
    Branch5X=curve_123,
    FlattenInputs=False)
entwine_5 = Entwine(Branch0X=entwine_4, Branch1X=entwine_3, Branch2X=interpolate.Curve, FlattenInputs=False)
curve_161 = Curve(entwine_4)
curve_162 = Curve(entwine_5)
