# Grasshopper definition HG...◯ⵘ◯ᔓᔕᑎИNᗱᗴᕤᕦ◯⚪◯ᕤᕦᗱᗴИNᑎᔓᔕ◯ⵘ◯⦿◯ⵘ◯ᔓᔕᑎИNᗱᗴᕤᕦ◯⚪◯ᕤᕦᗱᗴИNᑎᔓᔕ◯ⵘ◯ⵙ◯ⵘ◯ᔓᔕᑎИNᗱᗴᕤᕦ◯⚪◯ᕤᕦᗱᗴИNᑎᔓᔕ◯ⵘ◯⦿◯ⵘ◯ᔓᔕᑎИNᗱᗴᕤᕦ◯⚪◯ᕤᕦᗱᗴИNᑎᔓᔕ◯ⵘ◯...GH (Grasshopper 0.9.76)
# plug-ins: Pufferfish

number_slider = Slider(1, range=1..1.414213)

number_slider_2 = Slider(0.5, range=0..4)

division = Division(A=Slider(1, range=0..16), B=2)
square_root = SquareRoot(Value=division)
arc = Arc(Plane=PlaneXY(0, 0, 0), Radius=number_slider_2, Angle=Domain(0, -3.141592654))  # -> Arc, Length
multiplication = Multiplication(A=square_root, B=2)
addition = Addition(A=multiplication, B=number_slider_2)
subtraction = Subtraction(A=multiplication, B=number_slider_2)
vector_xyz = VectorXYZ(XComponent=multiplication, YComponent=0, ZComponent=0)  # -> Vector, Length
move = Move(Geometry=arc.Arc, Motion=vector_xyz.Vector)  # -> Geometry, Transform
rotate = Rotate(Geometry=move.Geometry, Angle=0.7853981634, Plane=PlaneXY(0, 0, 0))  # -> Geometry, Transform
revolution = Revolution(Curve=rotate.Geometry, Axis=Line((0, 0, 0), (1, 0, 0)), Domain=Domain(0, 1.570796327))
xz_plane = XZPlane(Origin=Point(0, 0, 0))
rotate_2 = Rotate(Geometry=revolution, Angle=1.570796327, Plane=PlaneXY(0, 0, 0))  # -> Geometry, Transform
rotate_3 = Rotate(Geometry=rotate_2.Geometry, Angle=-1.570796327, Plane=xz_plane)  # -> Geometry, Transform
rotate_4 = Rotate(Geometry=rotate_3.Geometry, Angle=1.570796327, Plane=PlaneXY(0, 0, 0))  # -> Geometry, Transform
rotate_5 = Rotate(Geometry=rotate_4.Geometry, Angle=-1.570796327, Plane=xz_plane)  # -> Geometry, Transform
brep_join = BrepJoin(Breps=[revolution, rotate_3.Geometry, rotate_5.Geometry])  # -> Breps, Closed

settings_custom = SettingsCustom(
    StitchSeams=True,
    SimplePlanes=False,
    Refine=False,
    MinCount=0,
    MaxCount=0,
    AspectRatio=0,
    MaxDistance=0,
    MaxAngle=Slider(4, range=1..17),
    MinEdge=0,
    MaxEdge=0)

data = Data(subtraction)
square_root_2 = SquareRoot(Value=2)
yz_plane = YZPlane(Origin=Point(0, 0, 0))
multiplication_2 = Multiplication(A=data, B=2)
division_2 = Division(A=multiplication_2, B=2)
sphere = Sphere(Base=PlaneXY(0, 0, 0), Radius=data)
division_3 = Division(A=data, B=square_root_2)
subtraction_2 = Subtraction(A=0, B=division_2)
xz_plane_2 = XZPlane(Origin=Point(0, 0, 0))
vector_xyz_2 = VectorXYZ(XComponent=0, YComponent=subtraction_2, ZComponent=subtraction_2)  # -> Vector, Length
yz_plane_2 = YZPlane(Origin=Point(0, 0, 0))
plane_surface = PlaneSurface(Plane=yz_plane, XSize=multiplication_2, YSize=multiplication_2)

multiplication_3 = Multiplication(A=division_3, B=number_slider)

move_2 = Move(Geometry=plane_surface, Motion=vector_xyz_2.Vector)  # -> Geometry, Transform
yz_plane_3 = YZPlane(Origin=Point(0, 0, 0))
rotate_6 = Rotate(Geometry=move_2.Geometry, Angle=1.570796327, Plane=PlaneXY(0, 0, 0))  # -> Geometry, Transform
rotate_7 = Rotate(Geometry=rotate_6.Geometry, Angle=1.570796327, Plane=yz_plane_3)  # -> Geometry, Transform

vector_xyz_3 = VectorXYZ(XComponent=multiplication_3, YComponent=0, ZComponent=0)  # -> Vector, Length
move_3 = Move(Geometry=plane_surface, Motion=vector_xyz_3.Vector)  # -> Geometry, Transform
move_4 = Move(Geometry=move_3.Geometry, Motion=vector_xyz_2.Vector)  # -> Geometry, Transform
plane_trim_surface = PlaneTrimSurface(Surface=sphere, Plane=move_2.Geometry, Flip=False)  # -> Trimmed, Intersected
plane_trim_surface_2 = PlaneTrimSurface(Surface=plane_trim_surface.Trimmed, Plane=rotate_6.Geometry, Flip=False)  # -> Trimmed, Intersected
rotate_8 = Rotate(Geometry=move_4.Geometry, Angle=1.570796327, Plane=xz_plane_2)  # -> Geometry, Transform
plane_trim_surface_3 = PlaneTrimSurface(Surface=plane_trim_surface_2.Trimmed, Plane=rotate_7.Geometry, Flip=False)  # -> Trimmed, Intersected
rotate_9 = Rotate(Geometry=rotate_8.Geometry, Angle=1.570796327, Plane=yz_plane_2)  # -> Geometry, Transform
mirror = Mirror(Geometry=move_4.Geometry, Plane=PlaneYZ(0, 0, 0))  # -> Geometry, Transform
plane_trim_surface_4 = PlaneTrimSurface(Surface=plane_trim_surface_3.Trimmed, Plane=move_4.Geometry, Flip=True)  # -> Trimmed, Intersected
brep_join_2 = BrepJoin(Breps=[move_4.Geometry, mirror.Geometry, rotate_8.Geometry])  # -> Breps, Closed
rotate_10 = Rotate(Geometry=mirror.Geometry, Angle=1.570796327, Plane=xz_plane_2)  # -> Geometry, Transform
rotate_11 = Rotate(Geometry=rotate_10.Geometry, Angle=1.570796327, Plane=yz_plane_2)  # -> Geometry, Transform
plane_trim_surface_5 = PlaneTrimSurface(Surface=plane_trim_surface_4.Trimmed, Plane=mirror.Geometry, Flip=False)  # -> Trimmed, Intersected
plane_trim_surface_6 = PlaneTrimSurface(Surface=plane_trim_surface_5.Trimmed, Plane=rotate_8.Geometry, Flip=True)  # -> Trimmed, Intersected
plane_trim_surface_7 = PlaneTrimSurface(Surface=plane_trim_surface_6.Trimmed, Plane=rotate_10.Geometry, Flip=False)  # -> Trimmed, Intersected
plane_trim_surface_8 = PlaneTrimSurface(Surface=plane_trim_surface_7.Trimmed, Plane=rotate_9.Geometry, Flip=True)  # -> Trimmed, Intersected
plane_trim_surface_9 = PlaneTrimSurface(Surface=plane_trim_surface_8.Trimmed, Plane=rotate_11.Geometry, Flip=False)  # -> Trimmed, Intersected

data_2 = Data(addition)
square_root_3 = SquareRoot(Value=2)
yz_plane_4 = YZPlane(Origin=Point(0, 0, 0))
multiplication_4 = Multiplication(A=data_2, B=2)
division_4 = Division(A=multiplication_4, B=2)
sphere_2 = Sphere(Base=PlaneXY(0, 0, 0), Radius=data_2)
division_5 = Division(A=data_2, B=square_root_3)
subtraction_3 = Subtraction(A=0, B=division_4)
xz_plane_3 = XZPlane(Origin=Point(0, 0, 0))
vector_xyz_4 = VectorXYZ(XComponent=0, YComponent=subtraction_3, ZComponent=subtraction_3)  # -> Vector, Length
yz_plane_5 = YZPlane(Origin=Point(0, 0, 0))
plane_surface_2 = PlaneSurface(Plane=yz_plane_4, XSize=multiplication_4, YSize=multiplication_4)

multiplication_5 = Multiplication(A=division_5, B=number_slider)

move_5 = Move(Geometry=plane_surface_2, Motion=vector_xyz_4.Vector)  # -> Geometry, Transform
yz_plane_6 = YZPlane(Origin=Point(0, 0, 0))
rotate_12 = Rotate(Geometry=move_5.Geometry, Angle=1.570796327, Plane=PlaneXY(0, 0, 0))  # -> Geometry, Transform
rotate_13 = Rotate(Geometry=rotate_12.Geometry, Angle=1.570796327, Plane=yz_plane_6)  # -> Geometry, Transform

vector_xyz_5 = VectorXYZ(XComponent=multiplication_5, YComponent=0, ZComponent=0)  # -> Vector, Length
move_6 = Move(Geometry=plane_surface_2, Motion=vector_xyz_5.Vector)  # -> Geometry, Transform
move_7 = Move(Geometry=move_6.Geometry, Motion=vector_xyz_4.Vector)  # -> Geometry, Transform
plane_trim_surface_10 = PlaneTrimSurface(Surface=sphere_2, Plane=move_5.Geometry, Flip=False)  # -> Trimmed, Intersected
plane_trim_surface_11 = PlaneTrimSurface(Surface=plane_trim_surface_10.Trimmed, Plane=rotate_12.Geometry, Flip=False)  # -> Trimmed, Intersected
rotate_14 = Rotate(Geometry=move_7.Geometry, Angle=1.570796327, Plane=xz_plane_3)  # -> Geometry, Transform
plane_trim_surface_12 = PlaneTrimSurface(Surface=plane_trim_surface_11.Trimmed, Plane=rotate_13.Geometry, Flip=False)  # -> Trimmed, Intersected
rotate_15 = Rotate(Geometry=rotate_14.Geometry, Angle=1.570796327, Plane=yz_plane_5)  # -> Geometry, Transform
mirror_2 = Mirror(Geometry=move_7.Geometry, Plane=PlaneYZ(0, 0, 0))  # -> Geometry, Transform
plane_trim_surface_13 = PlaneTrimSurface(Surface=plane_trim_surface_12.Trimmed, Plane=move_7.Geometry, Flip=True)  # -> Trimmed, Intersected
brep_join_3 = BrepJoin(Breps=[move_7.Geometry, mirror_2.Geometry, rotate_14.Geometry])  # -> Breps, Closed
rotate_16 = Rotate(Geometry=mirror_2.Geometry, Angle=1.570796327, Plane=xz_plane_3)  # -> Geometry, Transform
rotate_17 = Rotate(Geometry=rotate_16.Geometry, Angle=1.570796327, Plane=yz_plane_5)  # -> Geometry, Transform
plane_trim_surface_14 = PlaneTrimSurface(Surface=plane_trim_surface_13.Trimmed, Plane=mirror_2.Geometry, Flip=False)  # -> Trimmed, Intersected
plane_trim_surface_15 = PlaneTrimSurface(Surface=plane_trim_surface_14.Trimmed, Plane=rotate_14.Geometry, Flip=True)  # -> Trimmed, Intersected
plane_trim_surface_16 = PlaneTrimSurface(Surface=plane_trim_surface_15.Trimmed, Plane=rotate_16.Geometry, Flip=False)  # -> Trimmed, Intersected
plane_trim_surface_17 = PlaneTrimSurface(Surface=plane_trim_surface_16.Trimmed, Plane=rotate_15.Geometry, Flip=True)  # -> Trimmed, Intersected
plane_trim_surface_18 = PlaneTrimSurface(Surface=plane_trim_surface_17.Trimmed, Plane=rotate_17.Geometry, Flip=False)  # -> Trimmed, Intersected

brep_join_4 = BrepJoin(Breps=[brep_join.Breps, plane_trim_surface_18.Trimmed, plane_trim_surface_9.Trimmed])  # -> Breps, Closed
xz_plane_4 = XZPlane(Origin=Point(0, 0, 0))
mirror_3 = Mirror(Geometry=brep_join_4.Breps, Plane=PlaneYZ(0, 0, 0))  # -> Geometry, Transform
xy_plane = XYPlane(Origin=Point(0, 0, 0))
mirror_4 = Mirror(Geometry=[brep_join_4.Breps, mirror_3.Geometry], Plane=xz_plane_4)  # -> Geometry, Transform
mirror_5 = Mirror(Geometry=[mirror_4.Geometry, mirror_3.Geometry, brep_join_4.Breps], Plane=xy_plane)  # -> Geometry, Transform

brep_join_5 = BrepJoin(Breps=[brep_join_4.Breps, mirror_3.Geometry, mirror_4.Geometry, mirror_5.Geometry])  # -> Breps, Closed

mesh_brep = MeshBrep(Brep=brep_join_5.Breps, Settings=settings_custom)
