# Grasshopper definition HG.⠀⠀⠀⠀◯⠀ᕤᕦИNꖴ✻ᑐᑕᗩߦ⠀◯⠀ᗱᗴᙁᑐᑕᴥꖴᑐᑕ⠀◯⠀⠀⠀⠀ⵙ⠀⠀⠀⠀◯⠀ᑐᑕꖴᴥᑐᑕᙁᗱᗴ⠀◯⠀ߦᗩᑐᑕ✻ꖴИNᕤᕦ⠀◯⠀⠀⠀⠀.GH (Grasshopper 1.0.7)
# plug-ins: Anemone, BullAnt, Kangaroo2 Components

number_slider = Slider(4096, range=0..4096)
division = Division(A=360, B=number_slider)
addition = Addition(A=division, B=87.890625)
xy_plane = XYPlane(Origin=Point(0, 0, 0))
division_2 = Division(A=division, B=2)
radians = Radians(Degrees=addition)
radians_2 = Radians(Degrees=division)
arc = Arc(Plane=xy_plane, Radius=1000000, Angle=radians_2)  # -> Arc, Length
circle = Circle(Plane=PlaneXY(0, 0, 0), Radius=1000000)
line_sdl = LineSDL(Start=Point(0, 0, 0), Direction=Vector(0, 1, 0), Length=1000000)
negative = Negative(Value=division_2)
radians_3 = Radians(Degrees=negative)
rotate = Rotate(Geometry=line_sdl, Angle=radians_2, Plane=PlaneXY(0, 0, 0))  # -> Geometry, Transform
rotate_2 = Rotate(Geometry=line_sdl, Angle=radians_3, Plane=PlaneXY(0, 0, 0))  # -> Geometry, Transform
rotate_3 = Rotate(Geometry=arc.Arc, Angle=radians, Plane=PlaneXY(0, 0, 0))  # -> Geometry, Transform
point_on_curve = PointOnCurve(circle, parameter=0.25)
rotate_4 = Rotate(Geometry=rotate.Geometry, Angle=radians_3, Plane=PlaneXY(0, 0, 0))  # -> Geometry, Transform
yz_plane = YZPlane(Origin=Point(0, 0, 0))
rotate_5 = Rotate(Geometry=rotate_2.Geometry, Angle=0.7853981634, Plane=yz_plane)  # -> Geometry, Transform
rotate_6 = Rotate(Geometry=rotate_4.Geometry, Angle=0.7853981634, Plane=yz_plane)  # -> Geometry, Transform
curve = Curve(rotate_4.Geometry)
number_slider_2 = Slider(64, range=0..64)
number_slider_3 = Slider(14, range=0..254)
curve_2 = Curve(rotate_2.Geometry)
circle_tantantan = CircleTanTanTan(CurveA=circle, CurveB=curve, CurveC=curve_2, Point=point_on_curve)
length = Length(Curve=circle_tantantan)
xy_plane_2 = XYPlane(Origin=Point(0, 0, 0))
yz_plane_2 = YZPlane(Origin=Point(0, 0, 0))
xz_plane = XZPlane(Origin=Point(0, 0, 0))
loop_start = LoopStart(Repeat=number_slider_3, Trigger=Button(), Data=circle_tantantan)  # -> port, Counter, Data
panel = Panel(length)
cluster = Cluster(A=loop_start.Data, crv_2=curve, crv=curve_2)
square_root = SquareRoot(Value=2)
division_3 = Division(A=number_slider, B=square_root)
merge = Merge(Data1=loop_start.Data, Data2=cluster)
xy_plane_3 = XYPlane(Origin=Point(0, 0, 0))
number_slider_4 = Slider(181, range=0..256)
ggremoveduplicates = GgRemoveDuplicates(Curves=merge, Tol=0.001)
loop_end = LoopEnd(port=loop_start.port, Exit=False, Data=ggremoveduplicates, TimeOutVal=0, pausedState=False, state="Constant output")
addition_2 = Addition(A=number_slider_3, B=2)
circle_2 = Circle(Plane=xy_plane_3, Radius=0.01)  # disabled
text = Text("256")
length_2 = Length(Curve=loop_end)
panel_2 = Panel(length_2)
division_4 = Division(A=panel, B=panel_2)
rotate_7 = Rotate(Geometry=loop_end, Angle=0.7853981634, Plane=yz_plane_2)  # -> Geometry, Transform
panel_3 = Panel(division_4)
polar_array = PolarArray(Geometry=rotate_7.Geometry, Plane=xy_plane_2, Count=division_3, Angle=6.283185307)  # -> Geometry, Transform
division_5 = Division(A=length_2, B=6.283185307)
number_slider_5 = Slider(0.02, range=0..0.1)
panel_4 = Panel(polar_array.Geometry)
multipipe = MultiPipe(
    Curves=polar_array.Geometry,
    NodeSize=Slider(78.7, range=0..1024),
    EndOffset=0,
    StrutSize=Slider(31.8, range=0..64),
    Segment=Slider(63.349684, range=0..256),
    KinkAngle=Slider(0.102968, range=0..1),
    CubeFit=1,
    Caps=1)  # disabled

# ==== cluster Cluster
A = ClusterInput()
crv = ClusterInput()
crv_2 = ClusterInput()
curvepoint = PointOnCurve(A, parameter=0.5)
crv_3 = Curve(crv_2)
crv_4 = Curve(crv)
circlettt = CircleTanTanTan(CurveA=A, CurveB=crv_3, CurveC=crv_4, Point=curvepoint)
C = ClusterOutput(circlettt)
