# Grasshopper definition XHG..⠀⠀⠀⠀◯⠀ᗱᗴᴥᑎ✤ᗩᗯᴥᑎᑐᑕ⠀◯⠀ᗱᗴᗯꖴ✤ᗩᗯꖴᴥᗱᗴᗝ⠀◯⠀ᗝИNᗩ⠀◯⠀ᗱᗴИNꖴᔓᔕⓄᑐᑕ⠀◯⠀⊚⠀◯⠀ᗱᗴᙁ✤ᴥᑎ✤⠀◯⠀ᗱᗴᴥᑎ✤ᗩᗯᴥᑎᑐᑕ⠀◯⠀⠀⠀⠀ⵙ⠀⠀⠀⠀◯⠀ᑐᑕᑎᴥᗯᗩ✤ᑎᴥᗱᗴ⠀◯⠀✤ᑎᴥ✤ᙁᗱᗴ⠀◯⠀⊚⠀◯⠀ᑐᑕⓄᔓᔕꖴИNᗱᗴ⠀◯⠀ᗩИNᗝ⠀◯⠀ᗝᗱᗴᴥꖴᗯᗩ✤ꖴᗯᗱᗴ⠀◯⠀ᑐᑕᑎᴥᗯᗩ✤ᑎᴥᗱᗴ⠀◯⠀⠀⠀⠀..GHX (Grasshopper 1.0.7)
# plug-ins: Pufferfish

digit_scroller = DigitScroller(Scroller_Digits=12, Scroller_Prefix="Digit Scroller", Scroller_Radix=1, Scroller_Value=1)
digit_scroller_2 = DigitScroller(Scroller_Digits=12, Scroller_Prefix="Digit Scroller", Scroller_Radix=11, Scroller_Value=131)
digit_scroller_3 = DigitScroller(Scroller_Digits=12, Scroller_Prefix="Digit Scroller", Scroller_Radix=7, Scroller_Value=0.0025)
subtraction = Subtraction(A=digit_scroller_2, B=1)
multiplication = Multiplication(A=digit_scroller_3, B=subtraction)

dup = DuplicateData(Data=digit_scroller, Number=digit_scroller_2, Order=True)
panel = Panel(dup)
quick_graph = QuickGraph(panel, SortOrder=0)

series = Series(Start=0, Step=digit_scroller_3, Count=digit_scroller_2)
panel_2 = Panel(series)
quick_graph_2 = QuickGraph(panel_2, SortOrder=0)

panel_3 = Panel(series)
quick_graph_3 = QuickGraph(panel_3, SortOrder=0)
remap_numbers = RemapNumbers(Value=panel_3, Source=multiplication, Target=Domain(0, 1))  # -> Mapped, Clipped
quick_graph_4 = QuickGraph(remap_numbers.Mapped, SortOrder=0)
panel_4 = Panel(remap_numbers.Mapped)
quick_graph_5 = QuickGraph(panel_4, SortOrder=0)

panel_5 = Panel(remap_numbers.Mapped)
quick_graph_6 = QuickGraph(panel_5, SortOrder=0)
expression = Expression(X=panel_5, Expression="1/2*x^2+1/6*x^3+1/24*x^4+1/120*x^5+1/720*x^6+1/5040*x^7+1/40320*x^8++1/322560*x^9")
quick_graph_7 = QuickGraph(expression, SortOrder=0)
panel_6 = Panel(expression)
quick_graph_8 = QuickGraph(panel_6, SortOrder=0)

panel_7 = Panel(panel_4)
quick_graph_9 = QuickGraph(panel_7, SortOrder=0)
graph = GraphMapper(panel_7, x0=0, x1=1, y0=0, y1=1, container_name="Sine", Equation_px=[0, 1], Equation_py=[0, 0.4384952784])
quick_graph_10 = QuickGraph(graph, SortOrder=0)
panel_8 = Panel(graph)
quick_graph_11 = QuickGraph(panel_8, SortOrder=0)

stream_filter = StreamFilter(Gate=Slider(1, range=0..1), Stream0=panel_8, Stream1=expression)
panel_9 = Panel(stream_filter)
quick_graph_12 = QuickGraph(panel_9, SortOrder=0)

panel_10 = Panel(panel_9)
quick_graph_13 = QuickGraph(panel_10, SortOrder=0)
remap_numbers_2 = RemapNumbers(Value=panel_10, Source=Domain(0, 1), Target=multiplication)  # -> Mapped, Clipped
quick_graph_14 = QuickGraph(remap_numbers_2.Mapped, SortOrder=0)
panel_11 = Panel(remap_numbers_2.Mapped)
quick_graph_15 = QuickGraph(panel_11, SortOrder=0)

turtle = DotNETVBScriptLEGACY(Forward=dup, Left=panel_11)  # -> out, Points; inputs Forward: list, Left: list
# ---------- turtle: VB ----------
    Dim i As Integer
    Dim dir As New On3dVector(1, 0, 0)    
    Dim pos As New On3dVector(0, 0, 0) 
    Dim axis As New On3dVector(0, 0, 1)
    Dim pnts As New List(Of On3dVector)

    pnts.Add(pos)
    
    For i = 0 To Forward.Count() - 1
      Dim P As New On3dVector
      dir.Rotate(Left(i), axis)      
      P = dir * Forward(i) + pnts(i)
      pnts.Add(P)
    Next
    
    Points = pnts
# ---------- end turtle ----------
point = Point(turtle.Points)

panel_12 = Panel(turtle.Points)
quick_graph_16 = QuickGraph(panel_12, SortOrder=0)

intcrv = Interpolate(Vertices=point, Degree=3, Periodic=False)  # -> Curve, Length, Domain

digit_scroller_4 = DigitScroller(Scroller_Digits=12, Scroller_Prefix="Digit Scroller", Scroller_Radix=11, Scroller_Value=1)
digit_scroller_5 = DigitScroller(Scroller_Digits=12, Scroller_Prefix="Digit Scroller", Scroller_Radix=11, Scroller_Value=117)
curvature_graph = CurvatureGraph(Curve=intcrv.Curve, Density=digit_scroller_4, Scale=digit_scroller_5)

curve_length_between = CurveLengthBetween(Curve=intcrv.Curve, Points=point, Normalized=False)  # -> Lengths, Parameters
panel_13 = Panel(curve_length_between.Lengths)
