# Grasshopper definition XHG..ⵙᗱᗴⵙ✤ⵙᗩⵙᙁⵙߦⵙ◯ⵙ옷ⵙߦⵙᗩⵙᴥⵙᕤᕦⵙ◯ⵙᴥⵙᗱᗴⵙᗝⵙᗩⵙ옷ⵙᔓᔕⵙ⊚ⵙ◌ⵙ⊚ⵙ◌ⵙ⊚ⵙ◌ⵙ⚪ⵙ◯ⵙ◯ⵙ⚪ⵙ◌ⵙ⊚ⵙ◌ⵙ⊚ⵙ◌ⵙ⊚ⵙᔓᔕⵙ옷ⵙᗩⵙᗝⵙᗱᗴⵙᴥⵙ◯ⵙᕤᕦⵙᴥⵙᗩⵙߦⵙ옷ⵙ◯ⵙߦⵙᙁⵙᗩⵙ✤ⵙᗱᗴⵙ..GHX (Grasshopper 1.0.7)

digit_scroller = DigitScroller(Scroller_Digits=12, Scroller_Prefix="Digit Scroller", Scroller_Radix=11, Scroller_Value=4)
digit_scroller_2 = DigitScroller(Scroller_Digits=12, Scroller_Prefix="✺", Scroller_Radix=11, Scroller_Value=4)
curve = Curve(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)
evaluate_length = EvaluateLength(Curve=curve, Length=1, Normalized=True)  # -> Point, Tangent, Parameter
yz_plane = YZPlane(Origin=evaluate_length.Point)
curve_2 = Curve()  # disabled
line = Line(StartPoint=Point(1, 0, 0), EndPoint=Point(1, 1, 0))
move = Move(Geometry=line, Motion=Vector(-1, 0, 0))  # -> Geometry, Transform
digit_scroller_3 = DigitScroller(Scroller_Digits=12, Scroller_Prefix="✺", Scroller_Radix=11, Scroller_Value=1048576)  # disabled
range = Range(Domain=Domain(-1, 0), Steps=digit_scroller_3)  # disabled
expression = Expression(O=range, Expression="1-((1-(-O*1-1)^2)^(600.5/256/19.48046875)*(.65625)+(1-.65625))")  # disabled
construct_point = ConstructPoint(XCoordinate=range, YCoordinate=expression, ZCoordinate=0)  # disabled
interpolate_t = InterpolateT(Vertices=reverse(construct_point), TangentStart=Vector(0, 1, 0), TangentEnd=Vector(1, 0, 0), KnotStyle=1)  # -> Curve, Length, Domain; disabled
digit_scroller_4 = DigitScroller(Scroller_Digits=12, Scroller_Prefix="✺", Scroller_Radix=11, Scroller_Value=128)
divide_curve = DivideCurve(Curve=curve_2, Count=digit_scroller_4, Kinks=False)  # -> Points, Tangents, Parameters; disabled
interpolate_t_2 = InterpolateT(Vertices=divide_curve.Points, TangentStart=Vector(0, 1, 0), TangentEnd=Vector(1, 0, 0), KnotStyle=1)  # -> Curve, Length, Domain; disabled
digit_scroller_5 = DigitScroller(Scroller_Digits=12, Scroller_Prefix=" ", Scroller_Radix=11, Scroller_Value=87)
digit_scroller_6 = DigitScroller(Scroller_Digits=12, Scroller_Prefix="✺", Scroller_Radix=11, Scroller_Value=6)
power = Power(A=2, B=digit_scroller_6)
multiplication = Multiplication(A=power, B=0.5)
range_2 = Range(Domain=Domain(0, 1), Steps=multiplication)
multiplication_2 = Multiplication(A=range_2, B=6.283185307)
consecutive_domains = ConsecutiveDomains(Numbers=multiplication_2, Additive=False)
multiplication_3 = Multiplication(A=power, B=0.125)
divide_curve_2 = DivideCurve(Curve=curve, Count=multiplication_3, Kinks=False)  # -> Points, Tangents, Parameters
polyline = PolyLine(Vertices=divide_curve_2.Points, Closed=False)

# ---- group: 0
evaluate_length_2 = EvaluateLength(Curve=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, Length=0, Normalized=True)  # -> Point, Tangent, Parameter

# ----
yz_plane_2 = YZPlane(Origin=evaluate_length_2.Point)
range_3 = Range(Domain=Domain(0, 1), Steps=digit_scroller_3)  # disabled
expression_2 = Expression(O=range_3, Expression="(1-(O*1-1)^2)^(600.5/256/19.48046875)*(1-.65625)+.65625")  # disabled
construct_point_2 = ConstructPoint(XCoordinate=range_3, YCoordinate=expression_2, ZCoordinate=0)  # disabled
interpolate_t_3 = InterpolateT(Vertices=construct_point_2, TangentStart=Vector(0, 1, 0), TangentEnd=Vector(1, 0, 0), KnotStyle=1)  # -> Curve, Length, Domain; disabled
curve_3 = Curve(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)
divide_curve_3 = DivideCurve(Curve=curve_3, Count=multiplication_3, Kinks=False)  # -> Points, Tangents, Parameters
polyline_2 = PolyLine(Vertices=divide_curve_3.Points, Closed=False)
merge = Merge(Data1=polyline_2, Data2=polyline)
mirror = Mirror(Geometry=merge, Plane=yz_plane)  # -> Geometry, Transform
merge_2 = Merge(Data1=merge, Data2=mirror.Geometry)
move_2 = Move(Geometry=merge_2, Motion=Vector(-1, 0, 0))  # -> Geometry, Transform
join_curves = JoinCurves(Curves=move_2.Geometry, Preserve=False)
revolution = Revolution(Curve=join_curves, Axis=move.Geometry, Domain=consecutive_domains)
simple_mesh = SimpleMesh(Brep=revolution)
mirror_2 = Mirror(Geometry=join_curves, Plane=yz_plane_2)  # -> Geometry, Transform
merge_3 = Merge(Data1=join_curves, Data2=mirror_2.Geometry)
join_curves_2 = JoinCurves(Curves=merge_3, Preserve=False)
rotate = Rotate(Geometry=join_curves_2, Angle=-1.570796327, Plane=yz_plane_2)  # -> Geometry, Transform
bounding_box = BoundingBox(Content=rotate.Geometry, Plane=PlaneXY(0, 0, 0), UnionBox=True)  # -> Box, Box_2
deconstruct_box = DeconstructBox(Box=bounding_box.Box)  # -> Plane, X, Y, Z
deconstruct_domain = DeconstructDomain(Domain=deconstruct_box.X)  # -> Start, End
vector_xyz = VectorXYZ(XComponent=0, YComponent=0, ZComponent=expr("X-1", deconstruct_domain.Start))  # -> Vector, Length
curve_4 = Curve()  # disabled
divide_curve_4 = DivideCurve(Curve=curve_4, Count=digit_scroller_4, Kinks=False)  # -> Points, Tangents, Parameters; disabled
interpolate_t_4 = InterpolateT(Vertices=divide_curve_4.Points, TangentStart=Vector(0, 1, 0), TangentEnd=Vector(1, 0, 0), KnotStyle=1)  # -> Curve, Length, Domain; disabled
curvature_graph = CurvatureGraph(Curve=interpolate_t_4.Curve, Density=1, Scale=digit_scroller_5)  # disabled
evaluate_length_3 = EvaluateLength(Curve=rotate.Geometry, Length=0, Normalized=True)  # -> Point, Tangent, Parameter
vector_2pt = Vector2Pt(PointA=evaluate_length_2.Point, PointB=evaluate_length_3.Point, Unitize=False)  # -> Vector, Length
line_sdl = LineSDL(Start=evaluate_length_3.Point, Direction=Vector(0, -1, 0), Length=1)
xz_plane = XZPlane(Origin=evaluate_length_2.Point)
rotate_2 = Rotate(Geometry=rotate.Geometry, Angle=-1.570796327, Plane=xz_plane)  # -> Geometry, Transform
xy_plane = XYPlane(Origin=evaluate_length_2.Point)
rotate_3 = Rotate(Geometry=rotate_2.Geometry, Angle=-1.570796327, Plane=xy_plane)  # -> Geometry, Transform
move_3 = Move(Geometry=rotate_3.Geometry, Motion=vector_2pt.Vector)  # -> Geometry, Transform
digit_scroller_7 = DigitScroller(Scroller_Digits=12, Scroller_Prefix=" ", Scroller_Radix=11, Scroller_Value=91)
c_script = CSharpScript(C=curve_3)  # -> out, Cmax, Cmin, Pmax, Pmin; inputs C: Curve
# ---------- c_script: C# ----------
    double tmin = double.MaxValue;
    double tmax = double.MinValue;
    double t0 = 0, t1 = 0;

    int samples = C.SpanCount * 100;
    for (int i = 0; i <= samples; i++)
    {
      double t = (double) i / samples;
      t = C.Domain.ParameterAt(t);

      Vector3d curvature = C.CurvatureAt(t);
      double length = curvature.Length;

      if (length < tmin)
      {
        tmin = length;
        t0 = t;
      }

      if (length > tmax)
      {
        tmax = length;
        t1 = t;
      }
    }

    Cmin = t0;
    Cmax = t1;
    Pmin = C.PointAt(t0);
    Pmax = C.PointAt(t1);
# ---------- end c_script ----------
curvature = Curvature(Curve=curve_3, Parameter=c_script.Cmax)  # -> Point, Curvature, Curvature_2
deconstruct_arc = DeconstructArc(Arc=curvature.Curvature_2)  # -> BasePlane, Radius, Angle
division = Division(A=deconstruct_arc.Radius, B=deconstruct_domain.End)
scale = Scale(Geometry=move_3.Geometry, Center=evaluate_length_3.Point, Factor=division)  # -> Geometry, Transform
sweep1 = Sweep1(Rail=rotate.Geometry, Sections=scale.Geometry, Miter=2)
simple_mesh_2 = SimpleMesh(Brep=sweep1)
curve_domain = CurveDomain(Curve=scale.Geometry)  # -> Curve, Domain
deconstruct_domain_2 = DeconstructDomain(Domain=curve_domain.Domain)  # -> Start, End
division_2 = Division(A=deconstruct_domain_2.End, B=2)
construct_domain = ConstructDomain(DomainStart=deconstruct_domain_2.Start, DomainEnd=division_2)
sub_curve = SubCurve(BaseCurve=curve_domain.Curve, Domain=construct_domain)
eval = EvaluateCurve(Curve=curve_3, Parameter=c_script.Cmax)  # -> Point, Tangent, Angle; disabled
range_4 = Range(Domain=Domain(0, 1), Steps=expr("X/2", multiplication))
multiplication_4 = Multiplication(A=range_4, B=3.141592654)
consecutive_domains_2 = ConsecutiveDomains(Numbers=multiplication_4, Additive=False)
revolution_2 = Revolution(Curve=sub_curve, Axis=line_sdl, Domain=consecutive_domains_2)
simple_mesh_3 = SimpleMesh(Brep=revolution_2)
mirror_3 = Mirror(Geometry=simple_mesh_3, Plane=PlaneYZ(0, 0, 0))  # -> Geometry, Transform
merge_4 = Merge(Data1=simple_mesh_3, Data2=simple_mesh_2, Data3=mirror_3.Geometry)  # -> flatten(Result)
mesh_join = MeshJoin(Meshes=merge_4)
move_4 = Move(Geometry=mesh_join, Motion=vector_xyz.Vector)  # -> Geometry, Transform
polar_array = PolarArray(Geometry=move_4.Geometry, Plane=xz_plane, Count=4, Angle=6.283185307)  # -> Geometry, Transform
merge_5 = Merge(Data1=simple_mesh, Data2=polar_array.Geometry)  # -> flatten(Result)
mesh_join_2 = MeshJoin(Meshes=merge_5)
