# Grasshopper definition XHG.TXT.BИ.⚪∷⚪❋⚪ⵈ⚪⠿⚪·⚪⊚⚪ИN⚪Ⓞ⚪ꖴ⚪✤⚪ᑐᑕ⚪ИN⚪ᑎ⚪ꗳ⚪◯⚪ᔓᔕ⚪ᑎ⚪ꖴ⚪⚭⚪ᗩ⚪ꗳ⚪◌⚪◌⚪◌⚪◌⚪◌⚪◌⚪ꗳ⚪ᗩ⚪⚭⚪ꖴ⚪ᑎ⚪ᔓᔕ⚪◯⚪ꗳ⚪ᑎ⚪ИN⚪ᑐᑕ⚪✤⚪ꖴ⚪Ⓞ⚪ИN⚪⊚⚪·⚪⠿⚪ⵈ⚪❋⚪∷⚪.NB.TXT.GHX (Grasshopper 1.0.7)
# plug-ins: Anemone, Heteroptera, Pancake, CurvePlus

data = Data("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")  # disabled
data_2 = Data("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")  # disabled
data_3 = Data("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")  # disabled
data_4 = Data("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")  # disabled
data_5 = Data("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")
data_6 = Data("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")  # disabled
data_7 = Data("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")
read_file = ReadFile(File="C:\FABIUS 2048 X.TXT", PerLineParse=True)  # disabled
read_file_2 = ReadFile(File="C:\FABIUS 16384 X.TXT", PerLineParse=True)
read_file_3 = ReadFile(File="C:\FABIUS 2048 Y.TXT", PerLineParse=True)  # disabled
read_file_4 = ReadFile(File="C:\FABIUS 4096 X.TXT", PerLineParse=True)  # disabled
read_file_5 = ReadFile(File="C:\FABIUS 16384 Y.TXT", PerLineParse=True)
read_file_6 = ReadFile(File="C:\FABIUS 4096 Y.TXT", PerLineParse=True)  # disabled
y_1024 = Panel("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")  # disabled
y_128 = Panel("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")  # disabled
x_1024 = Panel("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")  # disabled
x_128 = Panel("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")  # disabled
curve = Curve(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)  # disabled
curve_2 = Curve(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)  # disabled
text_split = TextSplit(Text=x_1024, Separators=",")  # disabled
text_split_2 = TextSplit(Text=data, Separators=",")  # disabled
text_split_3 = TextSplit(Text=y_128, Separators=",")  # disabled
text_split_4 = TextSplit(Text=x_128, Separators=",")  # disabled
text_split_5 = TextSplit(Text=data_3, Separators=",")  # disabled
text_split_6 = TextSplit(Text=data_2, Separators=",")  # disabled
text_split_7 = TextSplit(Text=data_7, Separators=",")
text_split_8 = TextSplit(Text=data_6, Separators=",")  # disabled
text_split_9 = TextSplit(Text=data_5, Separators=",")
text_split_10 = TextSplit(Text=data_4, Separators=",")  # disabled
panel = Panel("0.0003419868677042794559/3*4")
concatenate = Concatenate(FragmentA=text_split, FragmentB="*65536")  # disabled
concatenate_2 = Concatenate(FragmentA=text_split_4, FragmentB="*65536")  # disabled
concatenate_3 = Concatenate(FragmentA=text_split_2, FragmentB="*65536")  # disabled
concatenate_4 = Concatenate(FragmentA=text_split_3, FragmentB="*65536")  # disabled
turn_step = DigitScroller(Scroller_Digits=12, Scroller_Prefix="TURN STEP", Scroller_Radix=2, Scroller_Value=0.0003419869)
concatenate_5 = Concatenate(FragmentA=text_split_6, FragmentB="*65536")  # disabled
concatenate_6 = Concatenate(FragmentA=text_split_5, FragmentB="*65536")  # disabled
panel_2 = Panel(text_split_2)  # disabled
concatenate_7 = Concatenate(FragmentA=text_split_9, FragmentB="*65536")
concatenate_8 = Concatenate(FragmentA=text_split_10, FragmentB="*65536")  # disabled
concatenate_9 = Concatenate(FragmentA=text_split_7, FragmentB="*65536")
concatenate_10 = Concatenate(FragmentA=text_split_8, FragmentB="*65536")  # disabled
segment_number = DigitScroller(Scroller_Digits=12, Scroller_Prefix="SEGMENT NUMBER", Scroller_Radix=11, Scroller_Value=1024)
panel_3 = Panel(text_split_5)  # disabled
panel_4 = Panel(text_split_8)  # disabled
panel_5 = Panel(text_split_7)

construct_point = ConstructPoint(XCoordinate=concatenate, YCoordinate=concatenate_3, ZCoordinate=0)  # disabled
construct_point_2 = ConstructPoint(XCoordinate=text_split, YCoordinate=text_split_2, ZCoordinate=0)  # disabled

construct_point_3 = ConstructPoint(XCoordinate=concatenate_2, YCoordinate=concatenate_4, ZCoordinate=0)  # disabled
construct_point_4 = ConstructPoint(XCoordinate=text_split_4, YCoordinate=text_split_3, ZCoordinate=0)  # disabled

subtraction = Subtraction(A=segment_number, B=2)
multiplication = Multiplication(A=subtraction, B=2)

construct_point_5 = ConstructPoint(XCoordinate=concatenate_5, YCoordinate=concatenate_6, ZCoordinate=0)  # disabled
construct_point_6 = ConstructPoint(XCoordinate=text_split_6, YCoordinate=text_split_5, ZCoordinate=0)  # disabled

construct_point_7 = ConstructPoint(XCoordinate=concatenate_7, YCoordinate=concatenate_9, ZCoordinate=0)
construct_point_8 = ConstructPoint(XCoordinate=text_split_9, YCoordinate=text_split_7, ZCoordinate=0)

construct_point_9 = ConstructPoint(XCoordinate=concatenate_8, YCoordinate=concatenate_10, ZCoordinate=0)  # disabled
construct_point_10 = ConstructPoint(XCoordinate=text_split_10, YCoordinate=text_split_8, ZCoordinate=0)  # disabled

division = Division(A=segment_number, B=2)
addition = Addition(A=division, B=2)

# ---- group: POINT NUMBER
addition_2 = Addition(A="0", B=addition)

# ----
one_over_x = OneOverX(Value=addition_2)
series = Series(Start=0, Step=expr("RAD(X)", graft("0.0003419868677042794559")), Count=addition)
duplicate_data = DuplicateData(Data=one_over_x, Number=addition_2, Order=True)
shift_list = ShiftList(List=duplicate_data, Shift=1, Wrap=False)
shift_list_2 = ShiftList(List=series, Shift=1, Wrap=False)
digit_scroller = DigitScroller(Scroller_Digits=12, Scroller_Prefix="მ6·მ6", Scroller_Radix=1, Scroller_Value=0.001953125)  # "მ6·მ6"
digit_scroller_2 = DigitScroller(Scroller_Digits=12, Scroller_Prefix="∷·∷", Scroller_Radix=1, Scroller_Value=0.001953125)
digit_scroller_3 = DigitScroller(Scroller_Digits=12, Scroller_Prefix="ЗԐ·ЗԐ", Scroller_Radix=1, Scroller_Value=0.001953125)  # "ЗԐ·ЗԐ"
digit_scroller_4 = DigitScroller(Scroller_Digits=12, Scroller_Prefix="꞉·꞉", Scroller_Radix=1, Scroller_Value=0.001953125)
digit_scroller_5 = DigitScroller(Scroller_Digits=12, Scroller_Prefix="❋", Scroller_Radix=1, Scroller_Value=0.001953125)
digit_scroller_6 = DigitScroller(Scroller_Digits=12, Scroller_Prefix="△", Scroller_Radix=2, Scroller_Value=0.001953125)
მ6 = DigitScroller(Scroller_Digits=12, Scroller_Prefix="მ6", Scroller_Radix=1, Scroller_Value=0.001953125)
ਟ5 = DigitScroller(Scroller_Digits=12, Scroller_Prefix="ਟ5", Scroller_Radix=3, Scroller_Value=0.001953125)
зԑ = DigitScroller(Scroller_Digits=12, Scroller_Prefix="ЗԐ", Scroller_Radix=1, Scroller_Value=0.001953125)
digit_scroller_7 = DigitScroller(Scroller_Digits=12, Scroller_Prefix="꞉", Scroller_Radix=1, Scroller_Value=0.001953125)
digit_scroller_8 = DigitScroller(Scroller_Digits=12, Scroller_Prefix="·", Scroller_Radix=1, Scroller_Value=0.001953125)
digit_scroller_9 = DigitScroller(Scroller_Digits=12, Scroller_Prefix="ਟ5·ਟ5", Scroller_Radix=1, Scroller_Value=0.001953125)  # "ਟ5·ਟ5"
digit_scroller_10 = DigitScroller(Scroller_Digits=12, Scroller_Prefix="···", Scroller_Radix=1, Scroller_Value=0.001953125)
digit_scroller_11 = DigitScroller(Scroller_Digits=12, Scroller_Prefix="0·0", Scroller_Radix=1, Scroller_Value=0.001953125)
digit_scroller_12 = DigitScroller(Scroller_Digits=12, Scroller_Prefix="⁂", Scroller_Radix=1, Scroller_Value=0.001953125)
digit_scroller_13 = DigitScroller(Scroller_Digits=12, Scroller_Prefix="∷", Scroller_Radix=1, Scroller_Value=0.001953125)
ᑐᑕ = DigitScroller(Scroller_Digits=12, Scroller_Prefix="ᑐᑕ", Scroller_Radix=1, Scroller_Value=0.001953125)
curve_3 = Curve(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)
scale = Scale(Geometry=curve_3, Center=Point(0, 0, 0), Factor=65536)  # -> Geometry, Transform
curve_4 = Curve(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)
nurbs_curve = NurbsCurve(Vertices=construct_point_7, Degree=11, Periodic=False)  # -> Curve, Length, Domain
interpolate = Interpolate(Vertices=construct_point_7, Degree=3, Periodic=False, KnotStyle=2)  # -> Curve, Length, Domain
number = Number(segment_number)
number_2 = Number(expr("X*65536", shift_list_2))
bounds = Bounds(Numbers=number_2)
curve_5 = Curve(interpolate.Curve)
end_points = EndPoints(Curve=curve_5)  # -> Start, End
rectangle_2pt = Rectangle2Pt(Plane=PlaneXY(0, 0, 0), PointA=end_points.Start, PointB=end_points.End, Radius=0)  # -> Rectangle, Length
graphmapper = GraphMapper(Curve=curve_5, Boundary=rectangle_2pt.Rectangle, Numbers=number_2, Input=bounds, Output=bounds, bobo=True)
number_3 = Number(expr("X/65536", graphmapper))
fast_loop_start = FastLoopStart(Iterations=2, D0=shift_list, D1=number_3)  # -> port, Counter, Data, Data_2
shift_list_3 = ShiftList(List=fast_loop_start.Data, Shift=-1, Wrap=False)  # -> reverse(List)
merge = Merge(Data1=fast_loop_start.Data, Data2=shift_list_3)  # -> flatten(Result)
shift_list_4 = ShiftList(List=fast_loop_start.Data_2, Shift=-1, Wrap=False)  # -> reverse(List)
merge_2 = Merge(Data1=fast_loop_start.Data_2, Data2=shift_list_4)  # -> flatten(Result)
fast_loop_end = FastLoopEnd(port=fast_loop_start.port, Exit=False, Data=merge, Data_2=merge_2, RecordData=False, TimeOutVal=0)  # -> flatten(D0), flatten(D1)
shift_list_5 = ShiftList(List=shift_list, Shift=-1, Wrap=False)  # -> reverse(List)
merge_3 = Merge(Data1=shift_list, Data2=shift_list_5)  # -> flatten(Result)
shift_list_6 = ShiftList(List=number_3, Shift=-1, Wrap=False)  # -> reverse(List)
merge_4 = Merge(Data1=number_3, Data2=shift_list_6)  # -> flatten(Result)
shift_list_7 = ShiftList(List=merge_3, Shift=-1, Wrap=False)  # -> reverse(List)
merge_5 = Merge(Data1=merge_3, Data2=shift_list_7)  # -> flatten(Result)
true_only_button = TrueOnlyButton(LastSaveLocalization="neutral,N")  # disabled
shift_list_8 = ShiftList(List=merge_4, Shift=-1, Wrap=False)  # -> reverse(List)
merge_6 = Merge(Data1=merge_4, Data2=shift_list_8)  # -> flatten(Result)
shift_list_9 = ShiftList(List=merge_5, Shift=-1, Wrap=False)  # -> reverse(List)
merge_7 = Merge(Data1=merge_5, Data2=shift_list_9)  # -> flatten(Result)
shift_list_10 = ShiftList(List=merge_6, Shift=-1, Wrap=False)  # -> reverse(List)
merge_8 = Merge(Data1=merge_6, Data2=shift_list_10)  # -> flatten(Result)
turtle = DotNETVBScriptLEGACY(Forward=fast_loop_end.D0, Left=fast_loop_end.D1)  # -> Output, Points; inputs Forward: list, Left: list
# ---------- turtle: VB ----------
    Dim i As Integer
    Dim dir As New On3dVector(1, 0, 0)
    Dim pos As New On3dVector(0, 0, 0)
    Dim axis As New On3dVector(0, 0, 1)
    Dim pnts As New List(Of On3dVector)

    pnts.Add(pos)

    For i = 0 To Forward.Count() - 1
      Dim P As New On3dVector
      dir.Rotate(Left(i), axis)
      P = dir * Forward(i) + pnts(i)
      pnts.Add(P)
    Next

    Points = pnts
# ---------- end turtle ----------
loop_start = LoopStart(Repeat=1, Trigger=true_only_button, D0=shift_list, D1=number_3)  # -> port, Counter, Data, Data_2; disabled
shift_list_11 = ShiftList(List=turtle.Points, Shift=-1, Wrap=False)
point = Point(shift_list_11)
cull_duplicates = CullDuplicates(Points=point, Tolerance=1.164153218e-10, CullMode=1)  # -> Points, Indices, Valence
interpolate_2 = Interpolate(Vertices=cull_duplicates.Points, Degree=3, Periodic=False, KnotStyle=2)  # -> Curve, Length, Domain
nurbs_curve_2 = NurbsCurve(Vertices=cull_duplicates.Points, Degree=11, Periodic=False)  # -> Curve, Length, Domain
bounding_box = BoundingBox(Content=interpolate_2.Curve, Plane=PlaneXY(0, 0, 0), UnionBox=True)  # -> Box, Box_2
deconstruct_box = DeconstructBox(Box=bounding_box.Box)  # -> Plane, X, Y, Z
evaluate_length = EvaluateLength(Curve=interpolate_2.Curve, Length=[0, 1], Normalized=True)  # -> Point, Tangent, Parameter
interpolate_3 = Interpolate(Vertices=cull_duplicates.Points, Degree=3, Periodic=False, KnotStyle=2)  # -> Curve, Length, Domain; disabled
deconstruct_domain = DeconstructDomain(Domain=deconstruct_box.X)  # -> expr("ABS(X)", Start), End
deconstruct_domain_2 = DeconstructDomain(Domain=deconstruct_box.Y)  # -> expr("ABS(X)", Start), End
addition_3 = Addition(A=deconstruct_domain.Start, B=deconstruct_domain.End)
addition_4 = Addition(A=deconstruct_domain_2.Start, B=deconstruct_domain_2.End)
format = Format(Format="{0:R}", Culture=127, Data0=evaluate_length.Tangent)
panel_6 = Panel(format)
scale_nu = ScaleNU(
    Geometry=interpolate_2.Curve,
    Plane=PlaneXY(0, 0, 0),
    ScaleX=expr("1/X", addition_3),
    ScaleY=expr("1/X", addition_4),
    ScaleZ=1)  # -> Geometry, Transform
close_curve = CloseCurve(Curve=scale_nu.Geometry, Factor=0.5, Continuity=0)  # disabled
diference_curwature_shaped_graph = DIFERENCECURWATURESHAPEDGRAPH(
    B_2=digit_scroller,
    B_3=digit_scroller_9,
    B_4=digit_scroller_2,
    B_5=digit_scroller_3,
    B_6=digit_scroller_4,
    B_7=digit_scroller_10,
    B_8=digit_scroller_11,
    B_9=digit_scroller_12,
    B_10=digit_scroller_5,
    B_11=digit_scroller_6,
    B_12=მ6,
    B_13=ਟ5,
    B_14=digit_scroller_13,
    B_15=зԑ,
    B_16=digit_scroller_7,
    B_17=digit_scroller_8,
    B=ᑐᑕ,
    angle=180,
    count=number,
    curve=scale_nu.Geometry)  # -> relay_3, relay_4, relay_5, relay_6, relay_7, relay_8, relay_9, relay_10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
loop_end = LoopEnd(port=loop_start.port, Exit=False, Data=merge, Data_2=merge_2, TimeOutVal=0, pausedState=False, state="Constant & Record")  # -> flatten(D0), flatten(D1); disabled

# ==== cluster DIFERENCECURWATURESHAPEDGRAPH
curve = ClusterInput()

digit_scroller = DigitScroller(Scroller_Digits=12, Scroller_Prefix=" ", Scroller_Radix=11, Scroller_Value=87)  # disabled
create_material = CreateMaterial(Diffuse=RGB(222, 222, 222), Specular=RGB(0, 255, 255), Emission=RGB(0, 0, 0), Transparency=0.5, Shine=100)
create_material_2 = CreateMaterial(Diffuse=RGB(247, 247, 247), Specular=RGB(0, 255, 255), Emission=RGB(0, 0, 0), Transparency=0.5, Shine=100)
create_material_3 = CreateMaterial(Diffuse=RGB(176, 176, 176), Specular=RGB(0, 255, 255), Emission=RGB(0, 0, 0), Transparency=0.5, Shine=100)
angle = ClusterInput()
curve_2 = Curve(graft(curve))
control_points = ControlPoints(Curve=curve_2)  # -> Points, Weights, Knots
list_length = ListLength(List=control_points.Points)  # -> expr("X-1", Length)
curve_degree = CurveDegree(Curve=curve_2)
expression = Expression(A=list_length, B=curve_degree, Expression="A-B+1")
length = Length(Curve=curve_2)
custom_preview = CustomPreview(Geometry=curve_2, Material=create_material_3)
count = ClusterInput()
divide_curve = DivideCurve(Curve=curve_2, Count=count, Kinks=False)  # -> Points, Tangents, Parameters
curvature = Curvature(Curve=curve_2, Parameter=divide_curve.Parameters)  # -> Point, Curvature, Curvature_2
deconstruct_arc = DeconstructArc(Arc=curvature.Curvature_2)  # -> BasePlane, Radius, Angle
line = Line(StartPoint=curvature.Point, EndPoint=deconstruct_arc.BasePlane)
one_over_x = OneOverX(Value=deconstruct_arc.Radius)
quick_graph = QuickGraph(one_over_x, SortOrder=0)
bounds = Bounds(Numbers=one_over_x)
relay = ClusterOutput(one_over_x)
remap_numbers = RemapNumbers(Value=one_over_x, Source=bounds, Target=Domain(0, 1))  # -> Mapped, Clipped
multiplication = Multiplication(A=length, B=remap_numbers.Mapped)
line_sdl = LineSDL(Start=divide_curve.Points, Direction=divide_curve.Tangents, Length=-1)
rotate = Rotate(Vector=curvature.Curvature, Axis=line_sdl, Angle=degrees(angle))
B = ClusterInput()
multiplication_2 = Multiplication(A=multiplication, B=B)
line_sdl_2 = LineSDL(Start=curvature.Point, Direction=rotate, Length=expr("-X", multiplication_2))
evaluate_length = EvaluateLength(Curve=line_sdl_2, Length=1, Normalized=True)  # -> Point, Tangent, Parameter
custom_preview_2 = CustomPreview(Geometry=line_sdl_2, Material=create_material_2)
number = Number(expression)
number_2 = Number(number)
curvature_graph = CurvatureGraph(Curve=curve_2, Density=1, Scale=digit_scroller)  # disabled
format = Format(Format="{0:R}", Culture=127, Data0=one_over_x)  # disabled
panel = Panel(format)
interpolate = Interpolate(Vertices=evaluate_length.Point, Degree=1, Periodic=False, KnotStyle=2)  # -> Curve, Length, Domain
curve_3 = Curve(interpolate.Curve)
custom_preview_3 = CustomPreview(Geometry=curve_3, Material=create_material)

explode = Explode(Curve=curve_3, Recursive=True)  # -> Segments, Vertices
evaluate_length_2 = EvaluateLength(Curve=explode.Segments, Length=0.5, Normalized=True)  # -> Point, Tangent, Parameter
curve_closest_point = CurveClosestPoint(Point=evaluate_length_2.Point, Curve=curve_2)  # -> Point, Parameter, Distance
line_2 = Line(StartPoint=curve_closest_point.Point, EndPoint=evaluate_length_2.Point)

replace_nulls = ReplaceNulls(Items=one_over_x, Replacements=0)  # -> Items, Count
relative_differences = RelativeDifferences(Values=replace_nulls.Items)
shift_list = ShiftList(List=relative_differences, Shift=1, Wrap=False)

replace_nulls_2 = ReplaceNulls(Items=shift_list, Replacements=0)  # -> Items, Count
relative_differences_2 = RelativeDifferences(Values=replace_nulls_2.Items)
shift_list_2 = ShiftList(List=relative_differences_2, Shift=1, Wrap=False)

replace_nulls_3 = ReplaceNulls(Items=shift_list_2, Replacements=0)  # -> Items, Count
relative_differences_3 = RelativeDifferences(Values=replace_nulls_3.Items)
shift_list_3 = ShiftList(List=relative_differences_3, Shift=1, Wrap=False)

replace_nulls_4 = ReplaceNulls(Items=shift_list_3, Replacements=0)  # -> Items, Count
relative_differences_4 = RelativeDifferences(Values=replace_nulls_4.Items)
shift_list_4 = ShiftList(List=relative_differences_4, Shift=1, Wrap=False)

replace_nulls_5 = ReplaceNulls(Items=shift_list_4, Replacements=0)  # -> Items, Count
relative_differences_5 = RelativeDifferences(Values=replace_nulls_5.Items)
shift_list_5 = ShiftList(List=relative_differences_5, Shift=1, Wrap=False)

expression_2 = Expression(O=shift_list_5, Expression="FORMAT(\"{0:R}\",O)")  # disabled
relay_2 = ClusterOutput(shift_list_5)
format_2 = Format(Format="{0:R}", Culture=127, Data0=shift_list_5)  # disabled
panel_2 = Panel(format_2)

replace_nulls_6 = ReplaceNulls(Items=shift_list_5, Replacements=0)  # -> Items, Count
relative_differences_6 = RelativeDifferences(Values=replace_nulls_6.Items)
shift_list_6 = ShiftList(List=relative_differences_6, Shift=1, Wrap=False)

replace_nulls_7 = ReplaceNulls(Items=shift_list_6, Replacements=0)  # -> Items, Count
relative_differences_7 = RelativeDifferences(Values=replace_nulls_7.Items)
shift_list_7 = ShiftList(List=relative_differences_7, Shift=1, Wrap=False)

replace_nulls_8 = ReplaceNulls(Items=shift_list_7, Replacements=0)  # -> Items, Count
relative_differences_8 = RelativeDifferences(Values=replace_nulls_8.Items)
shift_list_8 = ShiftList(List=relative_differences_8, Shift=1, Wrap=False)

replace_nulls_9 = ReplaceNulls(Items=shift_list_8, Replacements=0)  # -> Items, Count
relative_differences_9 = RelativeDifferences(Values=replace_nulls_9.Items)
shift_list_9 = ShiftList(List=relative_differences_9, Shift=1, Wrap=False)

replace_nulls_10 = ReplaceNulls(Items=shift_list_9, Replacements=0)  # -> Items, Count
relative_differences_10 = RelativeDifferences(Values=replace_nulls_10.Items)
shift_list_10 = ShiftList(List=relative_differences_10, Shift=1, Wrap=False)

replace_nulls_11 = ReplaceNulls(Items=shift_list_10, Replacements=0)  # -> Items, Count
relative_differences_11 = RelativeDifferences(Values=replace_nulls_11.Items)
shift_list_11 = ShiftList(List=relative_differences_11, Shift=1, Wrap=False)

replace_nulls_12 = ReplaceNulls(Items=shift_list_11, Replacements=0)  # -> Items, Count
relative_differences_12 = RelativeDifferences(Values=replace_nulls_12.Items)
shift_list_12 = ShiftList(List=relative_differences_12, Shift=1, Wrap=False)

replace_nulls_13 = ReplaceNulls(Items=shift_list_12, Replacements=0)  # -> Items, Count
relative_differences_13 = RelativeDifferences(Values=replace_nulls_13.Items)
shift_list_13 = ShiftList(List=relative_differences_13, Shift=1, Wrap=False)

replace_nulls_14 = ReplaceNulls(Items=shift_list_13, Replacements=0)  # -> Items, Count
relative_differences_14 = RelativeDifferences(Values=replace_nulls_14.Items)
shift_list_14 = ShiftList(List=relative_differences_14, Shift=1, Wrap=False)

replace_nulls_15 = ReplaceNulls(Items=shift_list_14, Replacements=0)  # -> Items, Count
relative_differences_15 = RelativeDifferences(Values=replace_nulls_15.Items)
shift_list_15 = ShiftList(List=relative_differences_15, Shift=1, Wrap=False)

replace_nulls_16 = ReplaceNulls(Items=shift_list_15, Replacements=0)  # -> Items, Count
relative_differences_16 = RelativeDifferences(Values=replace_nulls_16.Items)
shift_list_16 = ShiftList(List=relative_differences_16, Shift=1, Wrap=False)

bounds_2 = Bounds(Numbers=shift_list_16)
B_2 = ClusterInput()
remap_numbers_2 = RemapNumbers(Value=shift_list_16, Source=bounds_2, Target=Domain(-1, 1))  # -> Mapped, Clipped
multiplication_3 = Multiplication(A=length, B=remap_numbers_2.Mapped)
multiplication_4 = Multiplication(A=multiplication_3, B=B_2)

bounds_3 = Bounds(Numbers=shift_list_15)
B_3 = ClusterInput()
remap_numbers_3 = RemapNumbers(Value=shift_list_15, Source=bounds_3, Target=Domain(-1, 1))  # -> Mapped, Clipped
multiplication_5 = Multiplication(A=length, B=remap_numbers_3.Mapped)
multiplication_6 = Multiplication(A=multiplication_5, B=B_3)

bounds_4 = Bounds(Numbers=shift_list_14)
B_4 = ClusterInput()
remap_numbers_4 = RemapNumbers(Value=shift_list_14, Source=bounds_4, Target=Domain(-1, 1))  # -> Mapped, Clipped
multiplication_7 = Multiplication(A=length, B=remap_numbers_4.Mapped)
multiplication_8 = Multiplication(A=multiplication_7, B=B_4)

bounds_5 = Bounds(Numbers=shift_list_13)
B_5 = ClusterInput()
remap_numbers_5 = RemapNumbers(Value=shift_list_13, Source=bounds_5, Target=Domain(-1, 1))  # -> Mapped, Clipped
multiplication_9 = Multiplication(A=length, B=remap_numbers_5.Mapped)
multiplication_10 = Multiplication(A=multiplication_9, B=B_5)

bounds_6 = Bounds(Numbers=shift_list_12)
B_6 = ClusterInput()
remap_numbers_6 = RemapNumbers(Value=shift_list_12, Source=bounds_6, Target=Domain(-1, 1))  # -> Mapped, Clipped
multiplication_11 = Multiplication(A=length, B=remap_numbers_6.Mapped)
multiplication_12 = Multiplication(A=multiplication_11, B=B_6)

bounds_7 = Bounds(Numbers=shift_list_11)
B_7 = ClusterInput()
remap_numbers_7 = RemapNumbers(Value=shift_list_11, Source=bounds_7, Target=Domain(-1, 1))  # -> Mapped, Clipped
multiplication_13 = Multiplication(A=length, B=remap_numbers_7.Mapped)
multiplication_14 = Multiplication(A=multiplication_13, B=B_7)

bounds_8 = Bounds(Numbers=shift_list_10)
B_8 = ClusterInput()
remap_numbers_8 = RemapNumbers(Value=shift_list_10, Source=bounds_8, Target=Domain(-1, 1))  # -> Mapped, Clipped
multiplication_15 = Multiplication(A=length, B=remap_numbers_8.Mapped)
multiplication_16 = Multiplication(A=multiplication_15, B=B_8)

bounds_9 = Bounds(Numbers=shift_list_9)
B_9 = ClusterInput()
remap_numbers_9 = RemapNumbers(Value=shift_list_9, Source=bounds_9, Target=Domain(-1, 1))  # -> Mapped, Clipped
multiplication_17 = Multiplication(A=length, B=remap_numbers_9.Mapped)
multiplication_18 = Multiplication(A=multiplication_17, B=B_9)

bounds_10 = Bounds(Numbers=shift_list_8)
B_10 = ClusterInput()
remap_numbers_10 = RemapNumbers(Value=shift_list_8, Source=bounds_10, Target=Domain(-1, 1))  # -> Mapped, Clipped
multiplication_19 = Multiplication(A=length, B=remap_numbers_10.Mapped)
multiplication_20 = Multiplication(A=multiplication_19, B=B_10)

bounds_11 = Bounds(Numbers=shift_list_7)
B_11 = ClusterInput()
remap_numbers_11 = RemapNumbers(Value=shift_list_7, Source=bounds_11, Target=Domain(-1, 1))  # -> Mapped, Clipped
multiplication_21 = Multiplication(A=length, B=remap_numbers_11.Mapped)
multiplication_22 = Multiplication(A=multiplication_21, B=B_11)

bounds_12 = Bounds(Numbers=shift_list_6)
B_12 = ClusterInput()
remap_numbers_12 = RemapNumbers(Value=shift_list_6, Source=bounds_12, Target=Domain(-1, 1))  # -> Mapped, Clipped
multiplication_23 = Multiplication(A=length, B=remap_numbers_12.Mapped)
multiplication_24 = Multiplication(A=multiplication_23, B=B_12)

bounds_13 = Bounds(Numbers=shift_list_5)
B_13 = ClusterInput()
remap_numbers_13 = RemapNumbers(Value=shift_list_5, Source=bounds_13, Target=Domain(-1, 1))  # -> Mapped, Clipped
multiplication_25 = Multiplication(A=length, B=remap_numbers_13.Mapped)
multiplication_26 = Multiplication(A=multiplication_25, B=B_13)

bounds_14 = Bounds(Numbers=shift_list_4)
B_14 = ClusterInput()
remap_numbers_14 = RemapNumbers(Value=shift_list_4, Source=bounds_14, Target=Domain(-1, 1))  # -> Mapped, Clipped
multiplication_27 = Multiplication(A=length, B=remap_numbers_14.Mapped)
multiplication_28 = Multiplication(A=multiplication_27, B=B_14)

bounds_15 = Bounds(Numbers=shift_list_3)
B_15 = ClusterInput()
remap_numbers_15 = RemapNumbers(Value=shift_list_3, Source=bounds_15, Target=Domain(-1, 1))  # -> Mapped, Clipped
multiplication_29 = Multiplication(A=length, B=remap_numbers_15.Mapped)
multiplication_30 = Multiplication(A=multiplication_29, B=B_15)

bounds_16 = Bounds(Numbers=shift_list_2)
B_16 = ClusterInput()
remap_numbers_16 = RemapNumbers(Value=shift_list_2, Source=bounds_16, Target=Domain(-1, 1))  # -> Mapped, Clipped
multiplication_31 = Multiplication(A=length, B=remap_numbers_16.Mapped)
multiplication_32 = Multiplication(A=multiplication_31, B=B_16)

bounds_17 = Bounds(Numbers=shift_list)
B_17 = ClusterInput()
remap_numbers_17 = RemapNumbers(Value=shift_list, Source=bounds_17, Target=Domain(-1, 1))  # -> Mapped, Clipped
multiplication_33 = Multiplication(A=length, B=remap_numbers_17.Mapped)
multiplication_34 = Multiplication(A=multiplication_33, B=B_17)

quick_graph_2 = QuickGraph(shift_list, SortOrder=0)
create_material_4 = CreateMaterial(Diffuse=RGB(214, 214, 214), Specular=RGB(0, 255, 255), Emission=RGB(0, 0, 0), Transparency=0.5, Shine=100)
create_material_5 = CreateMaterial(Diffuse=RGB(240, 240, 240), Specular=RGB(0, 255, 255), Emission=RGB(0, 0, 0), Transparency=0.5, Shine=100)
line_sdl_3 = LineSDL(Start=evaluate_length_2.Point, Direction=line_2, Length=expr("ABS(X)", multiplication_34))
evaluate_length_3 = EvaluateLength(Curve=line_sdl_3, Length=1, Normalized=True)  # -> Point, Tangent, Parameter
custom_preview_4 = CustomPreview(Geometry=line_sdl_3, Material=create_material_5)
interpolate_2 = Interpolate(Vertices=evaluate_length_3.Point, Degree=1, Periodic=False, KnotStyle=2)  # -> Curve, Length, Domain
custom_preview_5 = CustomPreview(Geometry=interpolate_2.Curve, Material=create_material_4)

explode_2 = Explode(Curve=interpolate_2.Curve, Recursive=True)  # -> Segments, Vertices
evaluate_length_4 = EvaluateLength(Curve=explode_2.Segments, Length=0.5, Normalized=True)  # -> Point, Tangent, Parameter
curve_closest_point_2 = CurveClosestPoint(Point=evaluate_length_4.Point, Curve=curve_2)  # -> Point, Parameter, Distance
line_3 = Line(StartPoint=curve_closest_point_2.Point, EndPoint=evaluate_length_4.Point)

quick_graph_3 = QuickGraph(shift_list_2, SortOrder=0)
create_material_6 = CreateMaterial(Diffuse=RGB(207, 207, 207), Specular=RGB(0, 255, 255), Emission=RGB(0, 0, 0), Transparency=0.5, Shine=100)
create_material_7 = CreateMaterial(Diffuse=RGB(232, 232, 232), Specular=RGB(0, 255, 255), Emission=RGB(0, 0, 0), Transparency=0.5, Shine=100)
line_sdl_4 = LineSDL(Start=evaluate_length_4.Point, Direction=line_3, Length=expr("ABS(X)", multiplication_32))
evaluate_length_5 = EvaluateLength(Curve=line_sdl_4, Length=1, Normalized=True)  # -> Point, Tangent, Parameter
custom_preview_6 = CustomPreview(Geometry=line_sdl_4, Material=create_material_7)
interpolate_3 = Interpolate(Vertices=evaluate_length_5.Point, Degree=1, Periodic=False, KnotStyle=2)  # -> Curve, Length, Domain
custom_preview_7 = CustomPreview(Geometry=interpolate_3.Curve, Material=create_material_6)

explode_3 = Explode(Curve=interpolate_3.Curve, Recursive=True)  # -> Segments, Vertices
evaluate_length_6 = EvaluateLength(Curve=explode_3.Segments, Length=0.5, Normalized=True)  # -> Point, Tangent, Parameter
curve_closest_point_3 = CurveClosestPoint(Point=evaluate_length_6.Point, Curve=curve_2)  # -> Point, Parameter, Distance
line_4 = Line(StartPoint=curve_closest_point_3.Point, EndPoint=evaluate_length_6.Point)

quick_graph_4 = QuickGraph(shift_list_3, SortOrder=0)
create_material_8 = CreateMaterial(Diffuse=RGB(199, 199, 199), Specular=RGB(0, 255, 255), Emission=RGB(0, 0, 0), Transparency=0.5, Shine=100)
create_material_9 = CreateMaterial(Diffuse=RGB(224, 224, 224), Specular=RGB(0, 255, 255), Emission=RGB(0, 0, 0), Transparency=0.5, Shine=100)
line_sdl_5 = LineSDL(Start=evaluate_length_6.Point, Direction=line_4, Length=expr("ABS(X)", multiplication_30))
evaluate_length_7 = EvaluateLength(Curve=line_sdl_5, Length=1, Normalized=True)  # -> Point, Tangent, Parameter
custom_preview_8 = CustomPreview(Geometry=line_sdl_5, Material=create_material_9)
interpolate_4 = Interpolate(Vertices=evaluate_length_7.Point, Degree=1, Periodic=False, KnotStyle=2)  # -> Curve, Length, Domain
custom_preview_9 = CustomPreview(Geometry=interpolate_4.Curve, Material=create_material_8)

explode_4 = Explode(Curve=interpolate_4.Curve, Recursive=True)  # -> Segments, Vertices
evaluate_length_8 = EvaluateLength(Curve=explode_4.Segments, Length=0.5, Normalized=True)  # -> Point, Tangent, Parameter
curve_closest_point_4 = CurveClosestPoint(Point=evaluate_length_8.Point, Curve=curve_2)  # -> Point, Parameter, Distance
line_5 = Line(StartPoint=curve_closest_point_4.Point, EndPoint=evaluate_length_8.Point)

quick_graph_5 = QuickGraph(shift_list_4, SortOrder=0)
create_material_10 = CreateMaterial(Diffuse=RGB(191, 191, 191), Specular=RGB(0, 255, 255), Emission=RGB(0, 0, 0), Transparency=0.5, Shine=100)
create_material_11 = CreateMaterial(Diffuse=RGB(217, 217, 217), Specular=RGB(0, 255, 255), Emission=RGB(0, 0, 0), Transparency=0.5, Shine=100)
line_sdl_6 = LineSDL(Start=evaluate_length_8.Point, Direction=line_5, Length=expr("ABS(X)", multiplication_28))
evaluate_length_9 = EvaluateLength(Curve=line_sdl_6, Length=1, Normalized=True)  # -> Point, Tangent, Parameter
custom_preview_10 = CustomPreview(Geometry=line_sdl_6, Material=create_material_11)
interpolate_5 = Interpolate(Vertices=evaluate_length_9.Point, Degree=1, Periodic=False, KnotStyle=2)  # -> Curve, Length, Domain
custom_preview_11 = CustomPreview(Geometry=interpolate_5.Curve, Material=create_material_10)

explode_5 = Explode(Curve=interpolate_5.Curve, Recursive=True)  # -> Segments, Vertices
evaluate_length_10 = EvaluateLength(Curve=explode_5.Segments, Length=0.5, Normalized=True)  # -> Point, Tangent, Parameter
curve_closest_point_5 = CurveClosestPoint(Point=evaluate_length_10.Point, Curve=curve_2)  # -> Point, Parameter, Distance
line_6 = Line(StartPoint=curve_closest_point_5.Point, EndPoint=evaluate_length_10.Point)

quick_graph_6 = QuickGraph(shift_list_5, SortOrder=0)
create_material_12 = CreateMaterial(Diffuse=RGB(184, 184, 184), Specular=RGB(0, 255, 255), Emission=RGB(0, 0, 0), Transparency=0.5, Shine=100)
create_material_13 = CreateMaterial(Diffuse=RGB(209, 209, 209), Specular=RGB(0, 255, 255), Emission=RGB(0, 0, 0), Transparency=0.5, Shine=100)
line_sdl_7 = LineSDL(Start=evaluate_length_10.Point, Direction=line_6, Length=expr("ABS(X)", multiplication_26))
evaluate_length_11 = EvaluateLength(Curve=line_sdl_7, Length=1, Normalized=True)  # -> Point, Tangent, Parameter
custom_preview_12 = CustomPreview(Geometry=line_sdl_7, Material=create_material_13)
interpolate_6 = Interpolate(Vertices=evaluate_length_11.Point, Degree=1, Periodic=False, KnotStyle=2)  # -> Curve, Length, Domain
custom_preview_13 = CustomPreview(Geometry=interpolate_6.Curve, Material=create_material_12)

explode_6 = Explode(Curve=interpolate_6.Curve, Recursive=True)  # -> Segments, Vertices
evaluate_length_12 = EvaluateLength(Curve=explode_6.Segments, Length=0.5, Normalized=True)  # -> Point, Tangent, Parameter
curve_closest_point_6 = CurveClosestPoint(Point=evaluate_length_12.Point, Curve=curve_2)  # -> Point, Parameter, Distance
line_7 = Line(StartPoint=curve_closest_point_6.Point, EndPoint=evaluate_length_12.Point)

quick_graph_7 = QuickGraph(shift_list_6, SortOrder=0)
create_material_14 = CreateMaterial(Diffuse=RGB(176, 176, 176), Specular=RGB(0, 255, 255), Emission=RGB(0, 0, 0), Transparency=0.5, Shine=100)
create_material_15 = CreateMaterial(Diffuse=RGB(201, 201, 201), Specular=RGB(0, 255, 255), Emission=RGB(0, 0, 0), Transparency=0.5, Shine=100)
line_sdl_8 = LineSDL(Start=evaluate_length_12.Point, Direction=line_7, Length=expr("ABS(X)", multiplication_24))
evaluate_length_13 = EvaluateLength(Curve=line_sdl_8, Length=1, Normalized=True)  # -> Point, Tangent, Parameter
custom_preview_14 = CustomPreview(Geometry=line_sdl_8, Material=create_material_15)
interpolate_7 = Interpolate(Vertices=evaluate_length_13.Point, Degree=1, Periodic=False, KnotStyle=2)  # -> Curve, Length, Domain
custom_preview_15 = CustomPreview(Geometry=interpolate_7.Curve, Material=create_material_14)

explode_7 = Explode(Curve=interpolate_7.Curve, Recursive=True)  # -> Segments, Vertices
evaluate_length_14 = EvaluateLength(Curve=explode_7.Segments, Length=0.5, Normalized=True)  # -> Point, Tangent, Parameter
curve_closest_point_7 = CurveClosestPoint(Point=evaluate_length_14.Point, Curve=curve_2)  # -> Point, Parameter, Distance
line_8 = Line(StartPoint=curve_closest_point_7.Point, EndPoint=evaluate_length_14.Point)

quick_graph_8 = QuickGraph(shift_list_7, SortOrder=0)
create_material_16 = CreateMaterial(Diffuse=RGB(168, 168, 168), Specular=RGB(0, 255, 255), Emission=RGB(0, 0, 0), Transparency=0.5, Shine=100)
create_material_17 = CreateMaterial(Diffuse=RGB(194, 194, 194), Specular=RGB(0, 255, 255), Emission=RGB(0, 0, 0), Transparency=0.5, Shine=100)
line_sdl_9 = LineSDL(Start=evaluate_length_14.Point, Direction=line_8, Length=expr("ABS(X)", multiplication_22))
evaluate_length_15 = EvaluateLength(Curve=line_sdl_9, Length=1, Normalized=True)  # -> Point, Tangent, Parameter
custom_preview_16 = CustomPreview(Geometry=line_sdl_9, Material=create_material_17)
interpolate_8 = Interpolate(Vertices=evaluate_length_15.Point, Degree=1, Periodic=False, KnotStyle=2)  # -> Curve, Length, Domain
custom_preview_17 = CustomPreview(Geometry=interpolate_8.Curve, Material=create_material_16)

explode_8 = Explode(Curve=interpolate_8.Curve, Recursive=True)  # -> Segments, Vertices
evaluate_length_16 = EvaluateLength(Curve=explode_8.Segments, Length=0.5, Normalized=True)  # -> Point, Tangent, Parameter
curve_closest_point_8 = CurveClosestPoint(Point=evaluate_length_16.Point, Curve=curve_2)  # -> Point, Parameter, Distance
line_9 = Line(StartPoint=curve_closest_point_8.Point, EndPoint=evaluate_length_16.Point)

quick_graph_9 = QuickGraph(shift_list_8, SortOrder=0)
create_material_18 = CreateMaterial(Diffuse=RGB(161, 161, 161), Specular=RGB(0, 255, 255), Emission=RGB(0, 0, 0), Transparency=0.5, Shine=100)
create_material_19 = CreateMaterial(Diffuse=RGB(186, 186, 186), Specular=RGB(0, 255, 255), Emission=RGB(0, 0, 0), Transparency=0.5, Shine=100)
line_sdl_10 = LineSDL(Start=evaluate_length_16.Point, Direction=line_9, Length=expr("ABS(X)", multiplication_20))
evaluate_length_17 = EvaluateLength(Curve=line_sdl_10, Length=1, Normalized=True)  # -> Point, Tangent, Parameter
custom_preview_18 = CustomPreview(Geometry=line_sdl_10, Material=create_material_19)
interpolate_9 = Interpolate(Vertices=evaluate_length_17.Point, Degree=1, Periodic=False, KnotStyle=2)  # -> Curve, Length, Domain
custom_preview_19 = CustomPreview(Geometry=interpolate_9.Curve, Material=create_material_18)

explode_9 = Explode(Curve=interpolate_9.Curve, Recursive=True)  # -> Segments, Vertices
evaluate_length_18 = EvaluateLength(Curve=explode_9.Segments, Length=0.5, Normalized=True)  # -> Point, Tangent, Parameter
curve_closest_point_9 = CurveClosestPoint(Point=evaluate_length_18.Point, Curve=curve_2)  # -> Point, Parameter, Distance
line_10 = Line(StartPoint=curve_closest_point_9.Point, EndPoint=evaluate_length_18.Point)

quick_graph_10 = QuickGraph(shift_list_9, SortOrder=0)
create_material_20 = CreateMaterial(Diffuse=RGB(153, 153, 153), Specular=RGB(0, 255, 255), Emission=RGB(0, 0, 0), Transparency=0.5, Shine=100)
create_material_21 = CreateMaterial(Diffuse=RGB(178, 178, 178), Specular=RGB(0, 255, 255), Emission=RGB(0, 0, 0), Transparency=0.5, Shine=100)
line_sdl_11 = LineSDL(Start=evaluate_length_18.Point, Direction=line_10, Length=expr("ABS(X)", multiplication_18))
evaluate_length_19 = EvaluateLength(Curve=line_sdl_11, Length=1, Normalized=True)  # -> Point, Tangent, Parameter
custom_preview_20 = CustomPreview(Geometry=line_sdl_11, Material=create_material_21)
interpolate_10 = Interpolate(Vertices=evaluate_length_19.Point, Degree=1, Periodic=False, KnotStyle=2)  # -> Curve, Length, Domain
custom_preview_21 = CustomPreview(Geometry=interpolate_10.Curve, Material=create_material_20)

explode_10 = Explode(Curve=interpolate_10.Curve, Recursive=True)  # -> Segments, Vertices
evaluate_length_20 = EvaluateLength(Curve=explode_10.Segments, Length=0.5, Normalized=True)  # -> Point, Tangent, Parameter
curve_closest_point_10 = CurveClosestPoint(Point=evaluate_length_20.Point, Curve=curve_2)  # -> Point, Parameter, Distance
line_11 = Line(StartPoint=curve_closest_point_10.Point, EndPoint=evaluate_length_20.Point)

quick_graph_11 = QuickGraph(shift_list_10, SortOrder=0)
create_material_22 = CreateMaterial(Diffuse=RGB(145, 145, 145), Specular=RGB(0, 255, 255), Emission=RGB(0, 0, 0), Transparency=0.5, Shine=100)
create_material_23 = CreateMaterial(Diffuse=RGB(171, 171, 171), Specular=RGB(0, 255, 255), Emission=RGB(0, 0, 0), Transparency=0.5, Shine=100)
line_sdl_12 = LineSDL(Start=evaluate_length_20.Point, Direction=line_11, Length=expr("ABS(X)", multiplication_16))
evaluate_length_21 = EvaluateLength(Curve=line_sdl_12, Length=1, Normalized=True)  # -> Point, Tangent, Parameter
custom_preview_22 = CustomPreview(Geometry=line_sdl_12, Material=create_material_23)
interpolate_11 = Interpolate(Vertices=evaluate_length_21.Point, Degree=1, Periodic=False, KnotStyle=2)  # -> Curve, Length, Domain
custom_preview_23 = CustomPreview(Geometry=interpolate_11.Curve, Material=create_material_22)

explode_11 = Explode(Curve=interpolate_11.Curve, Recursive=True)  # -> Segments, Vertices
evaluate_length_22 = EvaluateLength(Curve=explode_11.Segments, Length=0.5, Normalized=True)  # -> Point, Tangent, Parameter
curve_closest_point_11 = CurveClosestPoint(Point=evaluate_length_22.Point, Curve=curve_2)  # -> Point, Parameter, Distance
line_12 = Line(StartPoint=curve_closest_point_11.Point, EndPoint=evaluate_length_22.Point)

quick_graph_12 = QuickGraph(shift_list_11, SortOrder=0)
create_material_24 = CreateMaterial(Diffuse=RGB(138, 138, 138), Specular=RGB(0, 255, 255), Emission=RGB(0, 0, 0), Transparency=0.5, Shine=100)
create_material_25 = CreateMaterial(Diffuse=RGB(163, 163, 163), Specular=RGB(0, 255, 255), Emission=RGB(0, 0, 0), Transparency=0.5, Shine=100)
line_sdl_13 = LineSDL(Start=evaluate_length_22.Point, Direction=line_12, Length=expr("ABS(X)", multiplication_14))
evaluate_length_23 = EvaluateLength(Curve=line_sdl_13, Length=1, Normalized=True)  # -> Point, Tangent, Parameter
custom_preview_24 = CustomPreview(Geometry=line_sdl_13, Material=create_material_25)
interpolate_12 = Interpolate(Vertices=evaluate_length_23.Point, Degree=1, Periodic=False, KnotStyle=2)  # -> Curve, Length, Domain
custom_preview_25 = CustomPreview(Geometry=interpolate_12.Curve, Material=create_material_24)

explode_12 = Explode(Curve=interpolate_12.Curve, Recursive=True)  # -> Segments, Vertices
evaluate_length_24 = EvaluateLength(Curve=explode_12.Segments, Length=0.5, Normalized=True)  # -> Point, Tangent, Parameter
curve_closest_point_12 = CurveClosestPoint(Point=evaluate_length_24.Point, Curve=curve_2)  # -> Point, Parameter, Distance
line_13 = Line(StartPoint=curve_closest_point_12.Point, EndPoint=evaluate_length_24.Point)

quick_graph_13 = QuickGraph(shift_list_12, SortOrder=0)
create_material_26 = CreateMaterial(Diffuse=RGB(130, 130, 130), Specular=RGB(0, 255, 255), Emission=RGB(0, 0, 0), Transparency=0.5, Shine=100)
create_material_27 = CreateMaterial(Diffuse=RGB(156, 156, 156), Specular=RGB(0, 255, 255), Emission=RGB(0, 0, 0), Transparency=0.5, Shine=100)
line_sdl_14 = LineSDL(Start=evaluate_length_24.Point, Direction=line_13, Length=expr("ABS(X)", multiplication_12))
evaluate_length_25 = EvaluateLength(Curve=line_sdl_14, Length=1, Normalized=True)  # -> Point, Tangent, Parameter
custom_preview_26 = CustomPreview(Geometry=line_sdl_14, Material=create_material_27)
interpolate_13 = Interpolate(Vertices=evaluate_length_25.Point, Degree=1, Periodic=False, KnotStyle=2)  # -> Curve, Length, Domain
custom_preview_27 = CustomPreview(Geometry=interpolate_13.Curve, Material=create_material_26)

explode_13 = Explode(Curve=interpolate_13.Curve, Recursive=True)  # -> Segments, Vertices
evaluate_length_26 = EvaluateLength(Curve=explode_13.Segments, Length=0.5, Normalized=True)  # -> Point, Tangent, Parameter
curve_closest_point_13 = CurveClosestPoint(Point=evaluate_length_26.Point, Curve=curve_2)  # -> Point, Parameter, Distance
line_14 = Line(StartPoint=curve_closest_point_13.Point, EndPoint=evaluate_length_26.Point)

quick_graph_14 = QuickGraph(shift_list_13, SortOrder=0)
create_material_28 = CreateMaterial(Diffuse=RGB(122, 122, 122), Specular=RGB(0, 255, 255), Emission=RGB(0, 0, 0), Transparency=0.5, Shine=100)
create_material_29 = CreateMaterial(Diffuse=RGB(148, 148, 148), Specular=RGB(0, 255, 255), Emission=RGB(0, 0, 0), Transparency=0.5, Shine=100)
line_sdl_15 = LineSDL(Start=evaluate_length_26.Point, Direction=line_14, Length=expr("ABS(X)", multiplication_10))
evaluate_length_27 = EvaluateLength(Curve=line_sdl_15, Length=1, Normalized=True)  # -> Point, Tangent, Parameter
custom_preview_28 = CustomPreview(Geometry=line_sdl_15, Material=create_material_29)
interpolate_14 = Interpolate(Vertices=evaluate_length_27.Point, Degree=1, Periodic=False, KnotStyle=2)  # -> Curve, Length, Domain
custom_preview_29 = CustomPreview(Geometry=interpolate_14.Curve, Material=create_material_28)

explode_14 = Explode(Curve=interpolate_14.Curve, Recursive=True)  # -> Segments, Vertices
evaluate_length_28 = EvaluateLength(Curve=explode_14.Segments, Length=0.5, Normalized=True)  # -> Point, Tangent, Parameter
curve_closest_point_14 = CurveClosestPoint(Point=evaluate_length_28.Point, Curve=curve_2)  # -> Point, Parameter, Distance
line_15 = Line(StartPoint=curve_closest_point_14.Point, EndPoint=evaluate_length_28.Point)

quick_graph_15 = QuickGraph(shift_list_14, SortOrder=0)
create_material_30 = CreateMaterial(Diffuse=RGB(115, 115, 115), Specular=RGB(0, 255, 255), Emission=RGB(0, 0, 0), Transparency=0.5, Shine=100)
create_material_31 = CreateMaterial(Diffuse=RGB(140, 140, 140), Specular=RGB(0, 255, 255), Emission=RGB(0, 0, 0), Transparency=0.5, Shine=100)
line_sdl_16 = LineSDL(Start=evaluate_length_28.Point, Direction=line_15, Length=expr("ABS(X)", multiplication_8))
evaluate_length_29 = EvaluateLength(Curve=line_sdl_16, Length=1, Normalized=True)  # -> Point, Tangent, Parameter
custom_preview_30 = CustomPreview(Geometry=line_sdl_16, Material=create_material_31)
interpolate_15 = Interpolate(Vertices=evaluate_length_29.Point, Degree=1, Periodic=False, KnotStyle=2)  # -> Curve, Length, Domain
custom_preview_31 = CustomPreview(Geometry=interpolate_15.Curve, Material=create_material_30)

explode_15 = Explode(Curve=interpolate_15.Curve, Recursive=True)  # -> Segments, Vertices
evaluate_length_30 = EvaluateLength(Curve=explode_15.Segments, Length=0.5, Normalized=True)  # -> Point, Tangent, Parameter
curve_closest_point_15 = CurveClosestPoint(Point=evaluate_length_30.Point, Curve=curve_2)  # -> Point, Parameter, Distance
line_16 = Line(StartPoint=curve_closest_point_15.Point, EndPoint=evaluate_length_30.Point)

quick_graph_16 = QuickGraph(shift_list_15, SortOrder=0)
create_material_32 = CreateMaterial(Diffuse=RGB(107, 107, 107), Specular=RGB(0, 255, 255), Emission=RGB(0, 0, 0), Transparency=0.5, Shine=100)
create_material_33 = CreateMaterial(Diffuse=RGB(133, 133, 133), Specular=RGB(0, 255, 255), Emission=RGB(0, 0, 0), Transparency=0.5, Shine=100)
line_sdl_17 = LineSDL(Start=evaluate_length_30.Point, Direction=line_16, Length=expr("ABS(X)", multiplication_6))
evaluate_length_31 = EvaluateLength(Curve=line_sdl_17, Length=1, Normalized=True)  # -> Point, Tangent, Parameter
custom_preview_32 = CustomPreview(Geometry=line_sdl_17, Material=create_material_33)
interpolate_16 = Interpolate(Vertices=evaluate_length_31.Point, Degree=1, Periodic=False, KnotStyle=2)  # -> Curve, Length, Domain
custom_preview_33 = CustomPreview(Geometry=interpolate_16.Curve, Material=create_material_32)

explode_16 = Explode(Curve=interpolate_16.Curve, Recursive=True)  # -> Segments, Vertices
evaluate_length_32 = EvaluateLength(Curve=explode_16.Segments, Length=0.5, Normalized=True)  # -> Point, Tangent, Parameter
curve_closest_point_16 = CurveClosestPoint(Point=evaluate_length_32.Point, Curve=curve_2)  # -> Point, Parameter, Distance
line_17 = Line(StartPoint=curve_closest_point_16.Point, EndPoint=evaluate_length_32.Point)

quick_graph_17 = QuickGraph(shift_list_16, SortOrder=0)
create_material_34 = CreateMaterial(Diffuse=RGB(99, 99, 99), Specular=RGB(0, 255, 255), Emission=RGB(0, 0, 0), Transparency=0.5, Shine=100)
create_material_35 = CreateMaterial(Diffuse=RGB(125, 125, 125), Specular=RGB(0, 255, 255), Emission=RGB(0, 0, 0), Transparency=0.5, Shine=100)
line_sdl_18 = LineSDL(Start=evaluate_length_32.Point, Direction=line_17, Length=expr("ABS(X)", multiplication_4))
evaluate_length_33 = EvaluateLength(Curve=line_sdl_18, Length=1, Normalized=True)  # -> Point, Tangent, Parameter
custom_preview_34 = CustomPreview(Geometry=line_sdl_18, Material=create_material_35)
interpolate_17 = Interpolate(Vertices=evaluate_length_33.Point, Degree=1, Periodic=False, KnotStyle=2)  # -> Curve, Length, Domain
custom_preview_35 = CustomPreview(Geometry=interpolate_17.Curve, Material=create_material_34)

relay_3 = ClusterOutput(shift_list_16)
format_3 = Format(Format="{0:R}", Culture=127, Data0=shift_list_16)  # disabled
panel_3 = Panel(format_3)

relay_4 = ClusterOutput(shift_list_15)
format_4 = Format(Format="{0:R}", Culture=127, Data0=shift_list_15)  # disabled
panel_4 = Panel(format_4)

relay_5 = ClusterOutput(shift_list_14)
format_5 = Format(Format="{0:R}", Culture=127, Data0=shift_list_14)  # disabled
panel_5 = Panel(format_5)

relay_6 = ClusterOutput(shift_list_13)
format_6 = Format(Format="{0:R}", Culture=127, Data0=shift_list_13)  # disabled
panel_6 = Panel(format_6)

relay_7 = ClusterOutput(shift_list_12)
format_7 = Format(Format="{0:R}", Culture=127, Data0=shift_list_12)  # disabled
panel_7 = Panel(format_7)

relay_8 = ClusterOutput(shift_list_11)
format_8 = Format(Format="{0:R}", Culture=127, Data0=shift_list_11)  # disabled
panel_8 = Panel(format_8)

relay_9 = ClusterOutput(shift_list_10)
format_9 = Format(Format="{0:R}", Culture=127, Data0=shift_list_10)  # disabled
panel_9 = Panel(format_9)

relay_10 = ClusterOutput(shift_list_9)
format_10 = Format(Format="{0:R}", Culture=127, Data0=shift_list_9)  # disabled
panel_10 = Panel(format_10)

relay_11 = ClusterOutput(shift_list_8)
format_11 = Format(Format="{0:R}", Culture=127, Data0=shift_list_8)  # disabled
panel_11 = Panel(format_11)

relay_12 = ClusterOutput(shift_list_7)
format_12 = Format(Format="{0:R}", Culture=127, Data0=shift_list_7)  # disabled
panel_12 = Panel(format_12)

relay_13 = ClusterOutput(shift_list_6)
format_13 = Format(Format="{0:R}", Culture=127, Data0=shift_list_6)  # disabled
panel_13 = Panel(format_13)

relay_14 = ClusterOutput(shift_list_4)
format_14 = Format(Format="{0:R}", Culture=127, Data0=shift_list_4)  # disabled
panel_14 = Panel(format_14)

relay_15 = ClusterOutput(shift_list_3)
format_15 = Format(Format="{0:R}", Culture=127, Data0=shift_list_3)  # disabled
panel_15 = Panel(format_15)

relay_16 = ClusterOutput(shift_list_2)
format_16 = Format(Format="{0:R}", Culture=127, Data0=shift_list_2)  # disabled
panel_16 = Panel(format_16)

relay_17 = ClusterOutput(shift_list)
format_17 = Format(Format="{0:R}", Culture=127, Data0=shift_list)  # disabled
panel_17 = Panel(format_17)

format_18 = Format(Format="{0:R}", Culture=127, Data0=deconstruct_arc.Radius)  # disabled
panel_18 = Panel(format_18)
