# Grasshopper definition XHG.TЯPDLƧ.ⵙⵘⵙ◯ⵙᔓᔕⵙᑎⵙИNⵙᗱᗴⵙᕤᕦⵙᴥⵙᗱᗴⵙߦⵙ人ⵙ옷ⵙ◯ⵙИNⵙⓄⵙᴥⵙᗝⵙᗱᗴⵙ옷ⵙᗩⵙ✤ⵙᑐᑕⵙⓄⵙ8ⵙᑎⵙᑐᑕⵙ⊚ⵙ◌ⵙ⊚ⵙ◌ⵙ⊚ⵙ◌ⵙ⚪ⵙ◯ⵙ◯ⵙ⚪ⵙ◌ⵙ⊚ⵙ◌ⵙ⊚ⵙ◌ⵙ⊚ⵙᑐᑕⵙᑎⵙ8ⵙⓄⵙᑐᑕⵙ✤ⵙᗩⵙ옷ⵙᗱᗴⵙᗝⵙᴥⵙⓄⵙИNⵙ◯ⵙ옷ⵙ人ⵙߦⵙᗱᗴⵙᴥⵙᕤᕦⵙᗱᗴⵙИNⵙᑎⵙᔓᔕⵙ◯ⵙⵘⵙ.SLDPRT.GHX (Grasshopper 1.0.7)

panel = Panel("0.2756013610640554832018211809411934093644161529690267726892185599")
curve = Curve(<curve referenced from the Rhino model>)
curve_domain = CurveDomain(Curve=curve)  # -> Curve, Domain
deconstruct_domain = DeconstructDomain(Domain=curve_domain.Domain)  # -> Start, End
subtraction = Subtraction(A=deconstruct_domain.End, B=deconstruct_domain.Start)
multiplication = Multiplication(A=panel, B=subtraction)
addition = Addition(A=deconstruct_domain.Start, B=multiplication)
construct_domain = ConstructDomain(DomainStart=deconstruct_domain.Start, DomainEnd=addition)
sub_curve = SubCurve(BaseCurve=curve_domain.Curve, Domain=construct_domain)
digit_scroller = DigitScroller(Scroller_Digits=12, Scroller_Prefix=" ", Scroller_Radix=11, Scroller_Value=4)
digit_scroller_2 = DigitScroller(Scroller_Digits=12, Scroller_Prefix=" ", Scroller_Radix=1, Scroller_Value=7.555122055)
panel_2 = Panel("4.3137948526439035")
curve_2 = Curve(<curve referenced from the Rhino model>)
curve_3 = Curve(<curve referenced from the Rhino model>)
merge = Merge(Data1=curve_2, Data2=curve_3)
join_curves = JoinCurves(Curves=merge, Preserve=False)
flip_curve = FlipCurve(Curve=join_curves)  # -> Curve, Flag
range = Range(Domain=Domain(0, 1), Steps=digit_scroller)
expression = Expression(O=range, OO="7.55512205489074473", Expression="1-(1/( (OO) ^ (O) ))")
number_slider = Slider(0.66, range=0..1)
curve_4 = Curve(<curve referenced from the Rhino model>)
flip_curve_2 = FlipCurve(Curve=curve_4)  # -> Curve, Flag
curve_5 = Curve(<curve referenced from the Rhino model>)
point_on_curve = PointOnCurve(curve_2, parameter=1)
panel_3 = Panel("0.2756013610640554832018211809411934093644161529690267726892185599")
bounds = Bounds(Numbers=expression)
remap_numbers = RemapNumbers(Value=expression, Source=bounds, Target=Domain(0, 1))  # -> Mapped, Clipped
evaluate_length = EvaluateLength(Curve=flip_curve.Curve, Length=remap_numbers.Mapped, Normalized=True)  # -> Point, Tangent, Parameter
tween_curve = TweenCurve(CurveA=flip_curve_2.Curve, CurveB=curve_5, Factor=remap_numbers.Mapped, BlendType=0)
list_item = ListItem(List=tween_curve, Index=2, Wrap=False)
curve_middle = CurveMiddle(Curve=list_item)
curve_closest_point = CurveClosestPoint(Point=curve_middle, Curve=<geometry referenced from the Rhino model>)  # -> Point, Parameter, Distance
list_item_2 = ListItem(List=remap_numbers.Mapped, Index=1, Wrap=False)
line = Line(StartPoint=Point(0, 0, 0), EndPoint=curve_middle)
rotate = Rotate(Geometry=<curve referenced from the Rhino model>, Angle=1.570796327, Plane=line)  # -> Geometry, Transform
curve_6 = Curve(<curve referenced from the Rhino model>)
curve_domain_2 = CurveDomain(Curve=curve_6)  # -> Curve, Domain
deconstruct_domain_2 = DeconstructDomain(Domain=curve_domain_2.Domain)  # -> Start, End
subtraction_2 = Subtraction(A=deconstruct_domain_2.End, B=deconstruct_domain_2.Start)
multiplication_2 = Multiplication(A=panel_3, B=subtraction_2)
addition_2 = Addition(A=deconstruct_domain_2.Start, B=multiplication_2)
construct_domain_2 = ConstructDomain(DomainStart=deconstruct_domain_2.Start, DomainEnd=addition_2)
sub_curve_2 = SubCurve(BaseCurve=curve_domain_2.Curve, Domain=construct_domain_2)
point_on_curve_2 = PointOnCurve(sub_curve_2, parameter=1)
curve_closest_point_2 = CurveClosestPoint(Point=point_on_curve_2, Curve=list_item)  # -> Point, Parameter, Distance
