# Grasshopper definition XHG.⚪ⵈ⚪⊚⚪ᔓᔕ⚪ᗱᗴ⚪ᙁ⚪ᑐᑕ⚪ᴥ⚪ꖴ⚪ᑐᑕ⚪◯⚪✤⚪ИN⚪ᗱᗴ⚪ᕤᕦ⚪ИN⚪ᗩ⚪✤⚪◯⚪ᙁ⚪ᗩ⚪ꖴ⚪ᗝ⚪ᗩ⚪ᴥ⚪◌⚪◌⚪◌⚪◌⚪◌⚪◌⚪ᴥ⚪ᗩ⚪ᗝ⚪ꖴ⚪ᗩ⚪ᙁ⚪◯⚪✤⚪ᗩ⚪ИN⚪ᕤᕦ⚪ᗱᗴ⚪ИN⚪✤⚪◯⚪ᑐᑕ⚪ꖴ⚪ᴥ⚪ᑐᑕ⚪ᙁ⚪ᗱᗴ⚪ᔓᔕ⚪⊚⚪ⵈ⚪.GHX (Grasshopper 1.0.7)
# plug-ins: Palette, CurvePlus, NGon, MeshEdit Components, Weaverbird

colour_swatch = ColourSwatch(SwatchColor=RGB(115, 115, 115))
colour_swatch_2 = ColourSwatch(SwatchColor=RGB(209, 209, 209))
colour_swatch_3 = ColourSwatch(SwatchColor=RGB(222, 222, 222))
colour_swatch_4 = ColourSwatch(SwatchColor=RGB(168, 168, 168))
colour_swatch_5 = ColourSwatch(SwatchColor=RGB(255, 255, 255))
colour_swatch_6 = ColourSwatch(SwatchColor=RGB(227, 227, 227))
palette = Palette(
    ModeCustomStandard=True,
    Component_Normal_Deselected_Fill_Color=colour_swatch_5,
    Component_Normal_Deselected_Edge_Color=colour_swatch_2,
    Component_Normal_Deselected_Text_Color=colour_swatch,
    Component_Normal_Selected_Fill_Color=colour_swatch_6,
    Component_Normal_Selected_Edge_Color=colour_swatch_2,
    Component_Normal_Selected_Text_Color=colour_swatch,
    Component_Hidden_Deselected_Fill_Color=colour_swatch_5,
    Component_Hidden_Deselected_Edge_Color=colour_swatch_2,
    Component_Hidden_Deselected_Text_Color=colour_swatch,
    Component_Hidden_Selected_Fill_Color=colour_swatch_6,
    Component_Hidden_Selected_Edge_Color=colour_swatch_2,
    Component_Hidden_Selected_Text_Color=colour_swatch,
    Component_Disabled_Deselected_Fill_Color=ColourSwatch(SwatchColor=RGB(196, 196, 196)),
    Component_Disabled_Deselected_Edge_Color=colour_swatch_2,
    Component_Disabled_Deselected_Text_Color=colour_swatch,
    Component_Disabled_Selected_Fill_Color=ColourSwatch(SwatchColor=RGB(176, 176, 176)),
    Component_Disabled_Selected_Edge_Color=colour_swatch_2,
    Component_Disabled_Selected_Text_Color=colour_swatch,
    Component_Warning_Deselected_Fill_Color=colour_swatch_5,
    Component_Warning_Deselected_Edge_Color=colour_swatch_2,
    Component_Warning_Deselected_Text_Color=colour_swatch,
    Component_Warning_Selected_Fill_Color=colour_swatch_6,
    Component_Warning_Selected_Edge_Color=colour_swatch_2,
    Component_Warning_Selected_Text_Color=colour_swatch,
    Component_Error_Deselected_Fill_Color=colour_swatch_5,
    Component_Error_Deselected_Edge_Color=colour_swatch_2,
    Component_Error_Deselected_Text_Color=colour_swatch,
    Component_Error_Selected_Fill_Color=RGB(255, 255, 255),
    Component_Error_Selected_Edge_Color=colour_swatch_2,
    Component_Error_Selected_Text_Color=colour_swatch,
    Component_Label_Deselected_Fill_Color=RGB(50, 50, 50),
    Component_Label_Deselected_Edge_Color=colour_swatch_2,
    Component_Label_Deselected_Text_Color=colour_swatch,
    Component_Label_Selected_Fill_Color=RGB(25, 60, 25),
    Component_Label_Selected_Edge_Color=colour_swatch_2,
    Component_Label_Selected_Text_Color=colour_swatch,
    Galapagos_Deselected_Fill_Color=RGB(252, 252, 252),
    Galapagos_Deselected_Edge_Color=colour_swatch_2,
    Galapagos_Selected_Fill_Color=RGB(255, 255, 255),
    Galapagos_Selected_Edge_Color=colour_swatch_2,
    Wire_Normal_Color=colour_swatch_3,
    Wire_Empty_Color=colour_swatch_3,
    Wire_Selected_Start_Color=colour_swatch_4,
    Wire_Selected_End_Color=colour_swatch_4,
    Panel_Default_Color=RGB(255, 255, 255),
    Group_Default_Color=RGB(255, 255, 255),
    Canvas_Background_Color=RGB(255, 255, 255),
    Canvas_Gridline_Color=RGB(240, 240, 240),
    Canvas_Gridline_Width=2,
    Canvas_Gridline_Height=2,
    Canvas_Edge_Color=RGB(207, 207, 207),
    Canvas_Shadow_Color=RGBA(237, 237, 237, 0),
    Canvas_Shadow_Size=2,
    MonochromaticOnOff=False,
    Monochromatic_Color=RGB(255, 255, 255))
infoglasses = InfoGlasses(
    Run=True,
    Language=0,
    BackGroundColor=RGB(255, 255, 255),
    BoundaryColor=RGB(115, 115, 115),
    English=True,
    FullName_Category=True,
    Merge_Box=True,
    TextColor=RGB(59, 59, 59),
    assemBoxWidth=1000,
    assemFontSize=8,
    assemSet=False,
    assemboxHeight=0,
    autoHeight=False,
    avoidPro=True,
    cateSet=False,
    highLightRadius=2,
    nameBoxDistance=1,
    nameBoxFontSize=8,
    showName=False,
    showNickName=False,
    showPlugin=False)  # disabled

digit_scroller = DigitScroller(Scroller_Digits=12, Scroller_Prefix=" ", Scroller_Radix=4, Scroller_Value=4)
digit_scroller_2 = DigitScroller(Scroller_Digits=12, Scroller_Prefix=" ", Scroller_Radix=4, Scroller_Value=64)
digit_scroller_3 = DigitScroller(Scroller_Digits=12, Scroller_Prefix=" ", Scroller_Radix=2, Scroller_Value=1)
digit_scroller_4 = DigitScroller(Scroller_Digits=12, Scroller_Prefix=" ", Scroller_Radix=11, Scroller_Value=0)
point = Point(Point(0, 0, 0))

number = Number(digit_scroller_2)
number_2 = Number(expr("X/4", digit_scroller_2))
number_3 = Number(digit_scroller_3)
point_2 = Point(point)
number_4 = Number(digit_scroller_4)
boolean = Boolean(Toggle(True))
boolean_2 = Boolean(Toggle(True))
boolean_3 = Boolean(Toggle(True))
boolean_4 = Boolean(Toggle(False))

inscribed_polygon = InscribedPolygon(Plane=PlaneXY(0, 0, 0), Radius=1, Sides=number)
expression = Expression(O=number, Expression="(SIN((4*ATAN(1))/O)/(1+SIN((4*ATAN(1))/O)))")
series = Series(Start=1, Step=1, Count=expr("X-1", number_2))
circle = Circle(Plane=point_2, Radius=number_3)
end_points = EndPoints(Curve=circle)  # -> Start, End
circumscribed_polygon = CircumscribedPolygon(Plane=point_2, Radius=number_3, Sides=number)
subtraction = Subtraction(A=digit_scroller_2, B=number_4)
division = Division(A=digit_scroller_2, B=subtraction)
stream_filter = StreamFilter(Gate=boolean_3, Stream1=circumscribed_polygon)
explode = Explode(Curve=stream_filter, Recursive=True)  # -> Segments, Vertices
division_2 = Division(A=number_3, B=number)
scale = Scale(Geometry=circle, Center=end_points.Start, Factor=expression)  # -> Geometry, Transform
area = Area(Geometry=circle)  # -> Area, Centroid
expression_2 = Expression(O=number, Expression="TAN(((4*ATAN(1))*(O-2))/(4*((O))))^2")
list_item = ListItem(List=explode.Segments, Index=-1, Wrap=True)
scale_2 = Scale(Geometry=list_item, Center=area.Centroid, Factor=expression_2)  # -> Geometry, Transform
power = Power(A=expression_2, B=series)
scale_3 = Scale(Geometry=scale.Geometry, Center=area.Centroid, Factor=power)  # -> Geometry, Transform
stream_filter_2 = StreamFilter(Gate=boolean_4, Stream0=scale_2.Geometry)
merge = Merge(Data1=list_item, Data2=scale_2.Geometry)
merge_2 = Merge(Data1=scale.Geometry, Data2=scale_3.Geometry)
stream_filter_3 = StreamFilter(Gate=boolean_4, Stream0=list_item)
flip_curve = FlipCurve(Curve=stream_filter_2)  # -> Curve, Flag
end_points_2 = EndPoints(Curve=merge)  # -> Start, End
stream_filter_4 = StreamFilter(Gate=boolean_4, Stream0=end_points_2.End)
stream_filter_5 = StreamFilter(Gate=boolean_4, Stream0=end_points_2.Start)
polyline = PolyLine(Vertices=stream_filter_5, Closed=False)
polyline_2 = PolyLine(Vertices=stream_filter_4, Closed=False)
flip_curve_2 = FlipCurve(Curve=polyline)  # -> Curve, Flag
greyville_points = GreyvillePoints(Curve=flip_curve_2.Curve)  # -> Points, Parameters
merge_3 = Merge(Data1=stream_filter_3, Data2=polyline_2, Data3=flip_curve.Curve, Data4=flip_curve_2.Curve)
merge_4 = Merge(Data1=end_points_2.Start, Data2=reverse(end_points_2.End))  # -> reverse(Result)
stream_filter_6 = StreamFilter(Gate=boolean_4, Stream1=merge_4)
point_list = PointList(Points=greyville_points.Points, Size=division_2)
join_curves = JoinCurves(Curves=merge_3, Preserve=True)
construct_mesh = ConstructMesh(Vertices=stream_filter_6, Faces={A=0, B=1, C=2, D=3})
point_list_2 = PointList(Points=merge_4, Size=division_2)
scale_4 = Scale(Geometry=construct_mesh, Center=point_2, Factor=power)  # -> Geometry, Transform
scale_5 = Scale(Geometry=join_curves, Center=point_2, Factor=power)  # -> Geometry, Transform
division_3 = Division(A=number, B=division)
division_4 = Division(A=number, B=division)
merge_5 = Merge(Data1=construct_mesh, Data2=scale_4.Geometry)
merge_6 = Merge(Data1=join_curves, Data2=scale_5.Geometry)

polar_array = PolarArray(Geometry=merge_2, Plane=point_2, Count=division_4, Angle=expr("360/X", degrees(division)))  # -> Geometry, Transform
polar_array_2 = PolarArray(Geometry=merge_6, Plane=point_2, Count=division_3, Angle=expr("360/X", degrees(division)))  # -> Geometry, Transform
polar_array_3 = PolarArray(Geometry=merge_5, Plane=point_2, Count=division_3, Angle=expr("360/X", degrees(division)))  # -> Geometry, Transform
mesh_join = MeshJoin(Meshes=flatten(polar_array_3.Geometry))

stream_filter_7 = StreamFilter(Gate=boolean_4, Stream0=polar_array_2.Geometry, Stream1=mesh_join)
digit_scroller_5 = DigitScroller(Scroller_Digits=12, Scroller_Prefix=" ", Scroller_Radix=11, Scroller_Value=3)
stream_filter_8 = StreamFilter(Gate=boolean, Stream1=polar_array.Geometry)
stream_filter_9 = StreamFilter(Gate=boolean, Stream1=stream_filter_7)

rotate = Rotate(Geometry=stream_filter_8, Angle=expr("180/X", degrees(number)), Plane=point_2)  # -> Geometry, Transform
rotate_2 = Rotate(Geometry=stream_filter_9, Angle=expr("180/X", degrees(number)), Plane=point_2)  # -> Geometry, Transform

stream_filter_10 = StreamFilter(Gate=boolean, Stream0=polar_array.Geometry, Stream1=rotate.Geometry)
stream_filter_11 = StreamFilter(Gate=boolean, Stream0=stream_filter_7, Stream1=rotate_2.Geometry)

expression_3 = Expression(O=number, Expression="COS(4*ATAN(1)/O)")
scale_6 = Scale(Geometry=stream_filter_10, Center=point_2, Factor=expression_3)  # -> Geometry, Transform
scale_7 = Scale(Geometry=stream_filter_11, Center=point_2, Factor=expression_3)  # -> Geometry, Transform

number_5 = Number(expr(".5/65536*64", 1))

stream_filter_12 = StreamFilter(Gate=boolean_2, Stream0=stream_filter_10, Stream1=scale_6.Geometry)
stream_filter_13 = StreamFilter(Gate=boolean_2, Stream0=stream_filter_11, Stream1=scale_7.Geometry)

rotate_3 = Rotate(Geometry=stream_filter_13, Angle=degrees(number_5), Plane=point_2)  # -> Geometry, Transform
rotate_4 = Rotate(Geometry=stream_filter_12, Angle=degrees(number_5), Plane=point_2)  # -> flatten(Geometry), Transform
greyville_points_2 = GreyvillePoints(Curve=rotate_3.Geometry)  # -> Points, Parameters
area_2 = Area(Geometry=rotate_4.Geometry)  # -> Area, Centroid
digit_scroller_6 = DigitScroller(Scroller_Digits=12, Scroller_Prefix=" ", Scroller_Radix=11, Scroller_Value=5)
power_of_2 = PowerOf2(Value=digit_scroller_6)
divide_curve = DivideCurve(Curve=rotate_4.Geometry, Count=power_of_2, Kinks=True)  # -> Points, Tangents, Parameters
rotate_5 = Rotate(Geometry=divide_curve.Points, Angle=expr("180/X", degrees(power_of_2)), Plane=graft(area_2.Centroid))  # -> Geometry, Transform
stream_filter_14 = StreamFilter(Gate=Slider(0, range=0..1), Stream0=rotate_5.Geometry, Stream1=greyville_points_2.Points)
deconstruct = Deconstruct(Point=stream_filter_14)  # -> XComponent, YComponent, ZComponent
stream_gate = StreamGate(Stream=deconstruct.XComponent, Gate=digit_scroller_5)  # -> Target0, Target1, Target2, Target3
stream_gate_2 = StreamGate(Stream=deconstruct.YComponent, Gate=digit_scroller_5)  # -> Target0, Target1, Target2, Target3

# ---- group: Circular_Lamé-based_Mapping_Inverse.cs
expression_4 = Expression(
    X=stream_gate.Target0,
    Y=stream_gate_2.Target0,
    Expression="((x/Sqrt(x^2+y^2))*Pow((abs(x)*(2/((1-abs(x))*(1-abs(y))))+abs(y)*(2/((1-abs(x))*(1-abs(y))))),(0.5*(1-abs(x))*(1-abs(y)))))")
expression_5 = Expression(
    X=stream_gate.Target0,
    Y=stream_gate_2.Target0,
    Expression="((y/Sqrt(x^2+y^2))*Pow((abs(x)*(2/((1-abs(x))*(1-abs(y))))+abs(y)*(2/((1-abs(x))*(1-abs(y))))),(0.5*(1-abs(x))*(1-abs(y)))))")

# ---- group: Circular_Tapered3_Mapping.cs
expression_6 = Expression(
    U=stream_gate.Target3,
    V=stream_gate_2.Target3,
    Expression="((((ABS(U)*ABS(V))/(U*V))/V)*SQRT((U^2+V^2-SQRT((U^2+V^2)*(U^2+V^2-2*U^2*V^2*(3-U^4-2*U^2*V^2-V^4))))/(3-U^4-2*U^2*V^2-V^4)))")
expression_7 = Expression(
    U=stream_gate.Target3,
    V=stream_gate_2.Target3,
    Expression="((((ABS(U)*ABS(V))/(U*V))/U)*SQRT((U^2+V^2-SQRT((U^2+V^2)*(U^2+V^2-2*U^2*V^2*(3-U^4-2*U^2*V^2-V^4))))/(3-U^4-2*U^2*V^2-V^4)))")

# ---- group: Circular_Area/Circular_Tapered3_Mapping_Inverse.cs
expression_8 = Expression(
    X=stream_gate.Target2,
    Y=stream_gate_2.Target2,
    Expression="((((ABS(X)*ABS(Y))/(X*Y))/(X*SQRT(X^2+Y^2)))*SQRT(1-SQRT(1-2*X^4*Y^2-2*X^2*Y^4+3*X^4*Y^4)))")
expression_9 = Expression(
    X=stream_gate.Target2,
    Y=stream_gate_2.Target2,
    Expression="((((ABS(X)*ABS(Y))/(X*Y))/(Y*SQRT(X^2+Y^2)))*SQRT(1-SQRT(1-2*X^4*Y^2-2*X^2*Y^4+3*X^4*Y^4)))")

# ---- group: Circular_Lamé-based_Mapping.cs
expression_10 = Expression(U=stream_gate.Target1, V=stream_gate_2.Target1, Expression="((abs(u) / u)*Pow(abs(u),(1-u^2-v^2)))")
expression_11 = Expression(U=stream_gate.Target1, V=stream_gate_2.Target1, Expression="((abs(v) / v)*Pow(abs(v),(1-u^2-v^2)))")

# ----
rectangle_2pt = Rectangle2Pt(Plane=PlaneXY(0, 0, 0), PointA=Point(1, -1, 0), PointB=Point(-1, 1, 0), Radius=0)  # -> Rectangle, Length
stream_filter_15 = StreamFilter(Gate=digit_scroller_5, Stream0=expression_4, Stream1=expression_10, Stream2=expression_9, Stream3=expression_6)
stream_filter_16 = StreamFilter(Gate=digit_scroller_5, Stream0=expression_5, Stream1=expression_11, Stream2=expression_8, Stream3=expression_7)
quad_sphere = QuadSphere(Base=PlaneXY(0, 0, 0), Radius=1)
deconstruct_brep = DeconstructBrep(Brep=quad_sphere)  # -> Faces, Edges, Vertices
list_item_2 = ListItem(List=deconstruct_brep.Faces, Index=0, Wrap=True)
construct_point = ConstructPoint(XCoordinate=stream_filter_15, YCoordinate=stream_filter_16, ZCoordinate=0)
move = Move(Geometry=construct_point, Motion=Vector(0, 0, 1))  # -> Geometry, Transform
pull_point = PullPoint(Point=move.Geometry, Geometry=list_item_2, ClosestOnly=True)  # -> ClosestPoint, Distance
polyline_3 = PolyLine(Vertices=pull_point.ClosestPoint, Closed=True)
interpolate = Interpolate(Vertices=pull_point.ClosestPoint, Degree=1, Periodic=True, KnotStyle=2)  # -> Curve, Length, Domain
nurbs_curve = NurbsCurve(Vertices=pull_point.ClosestPoint, Degree=11, Periodic=True)  # -> Curve, Length, Domain; disabled
point_3 = Point(flatten(move.Geometry))
from_polylines = FromPolylines(Curves=interpolate.Curve, Min_Triangulation=False)
rotate_6 = Rotate(Geometry=from_polylines, Angle=expr("-X", degrees(number_5)), Plane=point_2)  # -> Geometry, Transform
mirror = Mirror(Geometry=rotate_6.Geometry, Plane=PlaneXY(0, 0, 0))  # -> Geometry, Transform
merge_7 = Merge(Data1=rotate_6.Geometry, Data2=mirror.Geometry)
mirror_2 = Mirror(Geometry=merge_7, Plane=Plane(origin=(0, 0, 0), x=(-0.7071067812, 0, 0.7071067812), y=(0, -1, 0)))  # -> Geometry, Transform
mirror_3 = Mirror(Geometry=merge_7, Plane=Plane(origin=(0, 0, 0), x=(0, -0.7071067812, 0.7071067812), y=(1, 0, 0)))  # -> Geometry, Transform
merge_8 = Merge(Data1=merge_7, Data2=mirror_2.Geometry, Data3=mirror_3.Geometry)
greyville_points_3 = GreyvillePoints(Curve=rotate_6.Geometry)  # -> Points, Parameters
sift_pattern = SiftPattern(List=greyville_points_3.Points, SiftPattern=[0, 1, 2, 3, 4])  # -> Output0, Output1, Output2, Output3, Output4
mesh_join_2 = MeshJoin(Meshes=flatten(merge_8))
merge_9 = Merge(Data1=sift_pattern.Output0, Data2=sift_pattern.Output1, Data3=sift_pattern.Output2, Data4=sift_pattern.Output3)
mesh_weldvertices = MeshWeldVertices(Mesh=mesh_join_2, Tolerance=0.0006506192)  # -> RuntimeMessage, Mesh; disabled
clean_tree = CleanTree(RemoveNulls=True, RemoveInvalid=True, RemoveEmpty=True, Tree=merge_9)
construct_mesh_2 = ConstructMesh(Vertices=clean_tree, Faces={A=0, B=1, C=2, D=3})  # disabled
weaverbird_s_laplacian_smoothing = WeaverbirdsLaplacianSmoothing(MeshCurves=mesh_weldvertices.Mesh, Level=2048, SmoothNakedEdges=0, Thin=1)  # disabled
smooth_mesh = SmoothMesh(Mesh=mesh_weldvertices.Mesh, Strength=1, SkipNaked=True, Iterations=1024)  # disabled
deconstruct_mesh = DeconstructMesh(Mesh=smooth_mesh)  # -> Vertices, Faces, Colours, Normals; disabled
pull_point_2 = PullPoint(Point=deconstruct_mesh.Vertices, Geometry=quad_sphere, ClosestOnly=True)  # -> ClosestPoint, Distance; disabled
construct_mesh_3 = ConstructMesh(Vertices=pull_point_2.ClosestPoint, Faces=deconstruct_mesh.Faces)  # disabled
