# Grasshopper definition XHG.⚪꞉⚪⊚⚪ᔓᔕ⚪ᗱᗴ⚪ᙁ⚪ᑐᑕ⚪ᴥ⚪ꖴ⚪ᑐᑕ⚪◯⚪✤⚪ИN⚪ᗱᗴ⚪ᕤᕦ⚪ИN⚪ᗩ⚪✤⚪◯⚪ᙁ⚪ᗩ⚪ꖴ⚪ᗝ⚪ᗩ⚪ᴥ⚪◌⚪◌⚪◌⚪◌⚪◌⚪◌⚪ᴥ⚪ᗩ⚪ᗝ⚪ꖴ⚪ᗩ⚪ᙁ⚪◯⚪✤⚪ᗩ⚪ИN⚪ᕤᕦ⚪ᗱᗴ⚪ИN⚪✤⚪◯⚪ᑐᑕ⚪ꖴ⚪ᴥ⚪ᑐᑕ⚪ᙁ⚪ᗱᗴ⚪ᔓᔕ⚪⊚⚪꞉⚪.GHX (Grasshopper 1.0.7)
# plug-ins: Palette, CurvePlus

colour_swatch = ColourSwatch(SwatchColor=RGB(115, 115, 115))
colour_swatch_2 = ColourSwatch(SwatchColor=RGB(209, 209, 209))
colour_swatch_3 = ColourSwatch(SwatchColor=RGB(222, 222, 222))
colour_swatch_4 = ColourSwatch(SwatchColor=RGB(168, 168, 168))
colour_swatch_5 = ColourSwatch(SwatchColor=RGB(255, 255, 255))
colour_swatch_6 = ColourSwatch(SwatchColor=RGB(227, 227, 227))
palette = Palette(
    ModeCustomStandard=True,
    Component_Normal_Deselected_Fill_Color=colour_swatch_5,
    Component_Normal_Deselected_Edge_Color=colour_swatch_2,
    Component_Normal_Deselected_Text_Color=colour_swatch,
    Component_Normal_Selected_Fill_Color=colour_swatch_6,
    Component_Normal_Selected_Edge_Color=colour_swatch_2,
    Component_Normal_Selected_Text_Color=colour_swatch,
    Component_Hidden_Deselected_Fill_Color=colour_swatch_5,
    Component_Hidden_Deselected_Edge_Color=colour_swatch_2,
    Component_Hidden_Deselected_Text_Color=colour_swatch,
    Component_Hidden_Selected_Fill_Color=colour_swatch_6,
    Component_Hidden_Selected_Edge_Color=colour_swatch_2,
    Component_Hidden_Selected_Text_Color=colour_swatch,
    Component_Disabled_Deselected_Fill_Color=ColourSwatch(SwatchColor=RGB(196, 196, 196)),
    Component_Disabled_Deselected_Edge_Color=colour_swatch_2,
    Component_Disabled_Deselected_Text_Color=colour_swatch,
    Component_Disabled_Selected_Fill_Color=ColourSwatch(SwatchColor=RGB(176, 176, 176)),
    Component_Disabled_Selected_Edge_Color=colour_swatch_2,
    Component_Disabled_Selected_Text_Color=colour_swatch,
    Component_Warning_Deselected_Fill_Color=colour_swatch_5,
    Component_Warning_Deselected_Edge_Color=colour_swatch_2,
    Component_Warning_Deselected_Text_Color=colour_swatch,
    Component_Warning_Selected_Fill_Color=colour_swatch_6,
    Component_Warning_Selected_Edge_Color=colour_swatch_2,
    Component_Warning_Selected_Text_Color=colour_swatch,
    Component_Error_Deselected_Fill_Color=colour_swatch_5,
    Component_Error_Deselected_Edge_Color=colour_swatch_2,
    Component_Error_Deselected_Text_Color=colour_swatch,
    Component_Error_Selected_Fill_Color=RGB(255, 255, 255),
    Component_Error_Selected_Edge_Color=colour_swatch_2,
    Component_Error_Selected_Text_Color=colour_swatch,
    Component_Label_Deselected_Fill_Color=RGB(50, 50, 50),
    Component_Label_Deselected_Edge_Color=colour_swatch_2,
    Component_Label_Deselected_Text_Color=colour_swatch,
    Component_Label_Selected_Fill_Color=RGB(25, 60, 25),
    Component_Label_Selected_Edge_Color=colour_swatch_2,
    Component_Label_Selected_Text_Color=colour_swatch,
    Galapagos_Deselected_Fill_Color=RGB(252, 252, 252),
    Galapagos_Deselected_Edge_Color=colour_swatch_2,
    Galapagos_Selected_Fill_Color=RGB(255, 255, 255),
    Galapagos_Selected_Edge_Color=colour_swatch_2,
    Wire_Normal_Color=colour_swatch_3,
    Wire_Empty_Color=colour_swatch_3,
    Wire_Selected_Start_Color=colour_swatch_4,
    Wire_Selected_End_Color=colour_swatch_4,
    Panel_Default_Color=RGB(255, 255, 255),
    Group_Default_Color=RGB(255, 255, 255),
    Canvas_Background_Color=RGB(255, 255, 255),
    Canvas_Gridline_Color=RGB(240, 240, 240),
    Canvas_Gridline_Width=2,
    Canvas_Gridline_Height=2,
    Canvas_Edge_Color=RGB(207, 207, 207),
    Canvas_Shadow_Color=RGBA(237, 237, 237, 0),
    Canvas_Shadow_Size=2,
    MonochromaticOnOff=False,
    Monochromatic_Color=RGB(255, 255, 255))
infoglasses = InfoGlasses(
    Run=True,
    Language=0,
    BackGroundColor=RGB(255, 255, 255),
    BoundaryColor=RGB(115, 115, 115),
    English=True,
    FullName_Category=True,
    Merge_Box=True,
    TextColor=RGB(59, 59, 59),
    assemBoxWidth=1000,
    assemFontSize=8,
    assemSet=False,
    assemboxHeight=0,
    autoHeight=False,
    avoidPro=True,
    cateSet=False,
    highLightRadius=2,
    nameBoxDistance=1,
    nameBoxFontSize=8,
    showName=False,
    showNickName=False,
    showPlugin=False)  # disabled
digit_scroller = DigitScroller(Scroller_Digits=12, Scroller_Prefix=" ", Scroller_Radix=4, Scroller_Value=16)
digit_scroller_2 = DigitScroller(Scroller_Digits=12, Scroller_Prefix=" ", Scroller_Radix=2, Scroller_Value=1)
digit_scroller_3 = DigitScroller(Scroller_Digits=12, Scroller_Prefix=" ", Scroller_Radix=11, Scroller_Value=0)
digit_scroller_4 = DigitScroller(Scroller_Digits=12, Scroller_Prefix=" ", Scroller_Radix=4, Scroller_Value=8)
point = Point(Point(0, 0, 0))
number = Number(digit_scroller)
number_2 = Number(digit_scroller_2)
boolean = Boolean(Toggle(False))
number_3 = Number(digit_scroller_4)
point_2 = Point(point)
boolean_2 = Boolean(Toggle(True))
number_4 = Number(digit_scroller_3)
expression = Expression(O=number_3, Expression="(SIN((4*ATAN(1))/O)/(1+SIN((4*ATAN(1))/O)))")
series = Series(Start=1, Step=1, Count=expr("X-1", number))
circle = Circle(Plane=point_2, Radius=number_2)
evaluate_length = EvaluateLength(Curve=circle, Length=0, Normalized=True)  # -> Point, Tangent, Parameter
circumscribed_polygon = CircumscribedPolygon(Plane=point_2, Radius=number_2, Sides=number_3)
subtraction = Subtraction(A=digit_scroller_4, B=number_4)
division = Division(A=digit_scroller_4, B=subtraction)
explode = Explode(Curve=circumscribed_polygon, Recursive=True)  # -> Segments, Vertices
division_2 = Division(A=number_2, B=number_3)
scale = Scale(Geometry=circle, Center=evaluate_length.Point, Factor=expression)  # -> Geometry, Transform
area = Area(Geometry=circle)  # -> Area, Centroid
expression_2 = Expression(O=number_3, Expression="TAN(((4*ATAN(1))*(O-2))/(4*((O))))^2")
list_item = ListItem(List=explode.Segments, Index=-1, Wrap=True)
scale_2 = Scale(Geometry=list_item, Center=area.Centroid, Factor=expression_2)  # -> Geometry, Transform
power = Power(A=expression_2, B=series)
scale_3 = Scale(Geometry=scale.Geometry, Center=area.Centroid, Factor=power)  # -> Geometry, Transform
merge = Merge(Data1=list_item, Data2=scale_2.Geometry)
merge_2 = Merge(Data1=scale.Geometry, Data2=scale_3.Geometry)
end_points = EndPoints(Curve=merge)  # -> Start, End
merge_3 = Merge(Data1=end_points.Start, Data2=reverse(end_points.End))  # -> reverse(Result)
stream_filter = StreamFilter(Gate=boolean_2, Stream1=merge_3)
construct_mesh = ConstructMesh(Vertices=stream_filter, Faces={A=0, B=1, C=2, D=3})
scale_4 = Scale(Geometry=construct_mesh, Center=point_2, Factor=power)  # -> Geometry, Transform
point_list = PointList(Points=merge_3, Size=division_2)
division_3 = Division(A=number_3, B=division)
merge_4 = Merge(Data1=construct_mesh, Data2=scale_4.Geometry)
division_4 = Division(A=number_3, B=division)

polar_array = PolarArray(Geometry=merge_2, Plane=point_2, Count=division_4, Angle=expr("360/X", degrees(division)))  # -> Geometry, Transform
polar_array_2 = PolarArray(Geometry=merge_4, Plane=point_2, Count=division_3, Angle=expr("360/X", degrees(division)))  # -> Geometry, Transform
mesh_join = MeshJoin(Meshes=flatten(polar_array_2.Geometry))

rotate = Rotate(Geometry=polar_array.Geometry, Angle=expr("180/X", degrees(number_3)), Plane=point)  # -> Geometry, Transform
rotate_2 = Rotate(Geometry=mesh_join, Angle=expr("180/X", degrees(number_3)), Plane=point)  # -> Geometry, Transform

stream_filter_2 = StreamFilter(Gate=boolean, Stream0=polar_array.Geometry, Stream1=rotate.Geometry)
stream_filter_3 = StreamFilter(Gate=boolean, Stream0=mesh_join, Stream1=rotate_2.Geometry)
