# Grasshopper definition XHG.⠀⠀⠀⠀◯⠀ᗝꖴⓄ옷✤Ⓞᙁᑐᑕ⠀◯⠀⠀⠀⠀ⵙ⠀⠀⠀⠀◯⠀ᑐᑕᙁⓄ✤옷Ⓞꖴᗝ⠀◯⠀⠀⠀⠀.GHX (Grasshopper 0.5.90)

# This file generates a cornu spiral, approximated by a number of arcs.
# Each arc length is equal. Radius and rotation angle varies as follows:
# 
# 1st arc:   Radius=r,   Angle=v
# 2nd arc:   Radius=r/2,   Angle=v*2
# 2rd arc:   Radius=r/3,   Angle=v*3
# 4th arc:   Radius=r/4,   Angle=v*4
# and so on...
# 
# Mårten Nettelbladt
# 2008-11-05
number_of_rotations = Slider(50, range=1..75)
rotation_in_radians = Slider(0.0080078125, range=0..0.01)
# Plane to determine orientation of spiral
xz = XZPlane(O=Point(0, 0, 0))
# This script generates a list of points
vb = VBNETScript(x=xz, y=number_of_rotations, z=rotation_in_radians, InputCache_Param=["x", "y", "z"], OutputCache_Param=["A", "B", "C"])  # -> out, A, B, C
# ---------- vb: VB ----------
    ''' <your code>

    Dim pts As New List(Of On3dPoint)
    Dim EndPointLine As On3dPoint = x.PointAt(0, 100, 0)        'centre of first arc
    Dim Line As New OnLine(x.origin, EndPointLine)              '
    Dim pt As On3dPoint = Line.PointAt(0)                       'origin of spiral
    Dim rot As On3dPoint
    pts.Add(pt)
    
    Dim Vector As New On3dVector(x.PointAt(z / 2 * 100, 0, 0))
    Line.Translate(Vector)
    pt = Line.PointAt(0)                                        'second point on spiral
    pts.Add(pt)
		
    For i As Int32 = 1 To y
			
      rot = Line.PointAt(1 / i)
      Line.Rotate(z * i, x.zaxis, rot)                           'rotates line
      pt = Line.PointAt(0)                                       'third point on spiral etc
      pts.Add(pt)
    
    Next
		
		
    A = pts
		
    ''' </your code>
# ---------- end vb ----------
intcrv = Interpolate(V=vb.A, D=3, P=False)  # -> C, L, D
