# Grasshopper definition XHG.⠀⠀⠀⠀◯⠀ᗩ✤ᗩ✤ᑐᑕꖴ옷⠀◯⠀⊚⠀◯⠀ᗩНІᙁᗝ⠀◯⠀⊚⠀◯⠀ꖴᙏᗱᗴߦẎ⠀◯⠀⠀⠀⠀ⵙ⠀⠀⠀⠀◯⠀Ẏߦᗱᗴᙏꖴ⠀◯⠀⊚⠀◯⠀ᗝᙁІНᗩ⠀◯⠀⊚⠀◯⠀옷ꖴᑐᑕ✤ᗩ✤ᗩ⠀◯⠀⠀⠀⠀.GHX (Grasshopper 1.0.7)
# plug-ins: Firefly.X, CurvePlus, LunchBox

panel = Panel("84.406022589954030768899117092091000289089388918088900852079")
series = Series(Start="0", Step="1", Count="34")
power = Power(A="3", B=series)
division = Division(A=panel, B=power)
multiplication = Multiplication(A=division, B="299792458")
graft_tree = GraftTree(Tree=multiplication, IncludeEmptyLists=True, IncludeNullItems=True)
graft_tree_2 = GraftTree(Tree=division, IncludeEmptyLists=True, IncludeNullItems=True)
division_2 = Division(A=power, B=panel)
graft_tree_3 = GraftTree(Tree=division_2, IncludeEmptyLists=True, IncludeNullItems=True)
power_2 = Power(A="3", B="6")
data = Data([graft_tree_2, graft_tree_3, graft_tree])
construct_point = ConstructPoint(XCoordinate=0, YCoordinate=graft_tree_2, ZCoordinate=0)
division_3 = Division(A=panel, B=power_2)
one_over_x = OneOverX(Value=power_2)
addition = Addition(A=series, B=1)
X = Expression(x=data, Expression="Format(\"{0:0.0000000000000000000000000000}\", x)")
panel_2 = Panel(X)
data_2 = Data("METERS    ")
data_3 = Data("SECONDS    ")
numbers_to_points = NumbersToPoints(Numbers=panel_2, Mask=4)
data_4 = Data("HERTZ    ")
data_5 = Data(panel_2)
line = Line(StartPoint=Point(0, 0, 0), EndPoint=construct_point)
concatenate = Concatenate(FragmentA=[data_3, data_4, data_2], FragmentB=data_5)
spiral_rail = SpiralRail(Curve=line, Angle=0, Turns=1, BaseRadius=construct_point, PeakRadius=construct_point, SamplePoint=256)
xz_plane = XZPlane(Origin=Point(0, 0, 0))
rotate = Rotate(Geometry=spiral_rail, Angle=1.570796327, Plane=xz_plane)  # -> Geometry, Transform
text_tag = TextTag(Location=construct_point, Text=numbers_to_points, Colour=RGB(212, 212, 212))
tone_generator = ToneGenerator(AudioFrequency=division_2, Volume=one_over_x, Duration=division_3, Repeat=Toggle(True))
panel_3 = Panel(concatenate)
excel_write = ExcelWrite(
    WriteExcelData=True,
    WorkbookPath="C:\O.XLS",
    WorksheetName="Sheet1",
    ColumnHeadings=addition,
    Data=panel_3,
    ClearSheet=False)
