# Grasshopper definition XHG.⠀⠀⠀⠀◯⠀ᗱᗴᙁ✤ᴥᑎ✤⠀◯⠀ᗱᗴᴥᑎ✤ᗩᗯᴥᑎᑐᑕ⠀◯⠀⠀⠀⠀ⵙ⠀⠀⠀⠀◯⠀ᑐᑕᑎᴥᗯᗩ✤ᑎᴥᗱᗴ⠀◯⠀✤ᑎᴥ✤ᙁᗱᗴ⠀◯⠀⠀⠀⠀.GHX (Grasshopper 1.0.7)

digit_scroller = DigitScroller(Scroller_Digits=12, Scroller_Prefix="Digit Scroller", Scroller_Radix=10, Scroller_Value=2)
number_slider = Slider(256, range=0..1000)
digit_scroller_2 = DigitScroller(Scroller_Digits=12, Scroller_Prefix="Digit Scroller", Scroller_Radix=10, Scroller_Value=2)
forward = Slider(1, range=0..1)
left = Slider(0.000711, range=0..0.003906)
series = Series(Start=0, Step=left, Count=number_slider)
dup = DuplicateData(Data=forward, Number=number_slider, Order=True)
expression = Expression(
    X=series,
    O_EZIS_O_SIZE_O=Slider(1, range=0..2),
    O_REWOP_TOOR_O_ROOT_POWER_O=digit_scroller,
    O_REWOP_O_POWER_O=digit_scroller_2,
    Expression="(O_EZIS_O_SIZE_O^O_REWOP_O_POWER_O-abs(X-1)^O_REWOP_O_POWER_O)^(1/O_REWOP_TOOR_O_ROOT_POWER_O)")
graph = GraphMapper(series, x0=0, x1=0.0625, y0=0, y1=0.0625, container_name="Sine", Equation_px=[0, 0.2859621942], Equation_py=[0, 1])
stream_filter = StreamFilter(Gate=Slider(0, range=0..1), Stream0=graph, Stream1=expression)
turtle = DotNETVBScriptLEGACY(Forward=dup, Left=stream_filter)  # -> out, Points; inputs Forward: list, Left: list
# ---------- turtle: VB ----------
    Dim i As Integer
    Dim dir As New On3dVector(1, 0, 0)    
    Dim pos As New On3dVector(0, 0, 0) 
    Dim axis As New On3dVector(0, 0, 1)
    Dim pnts As New List(Of On3dVector)

    pnts.Add(pos)
    
    For i = 0 To Forward.Count() - 1
      Dim P As New On3dVector
      dir.Rotate(Left(i), axis)      
      P = dir * Forward(i) + pnts(i)
      pnts.Add(P)
    Next
    
    Points = pnts
# ---------- end turtle ----------
intcrv = Interpolate(Vertices=turtle.Points, Degree=3, Periodic=False)  # -> Curve, Length, Domain
curvature_graph = CurvatureGraph(Curve=intcrv.Curve, Density=Slider(1, range=1..10), Scale=Slider(106, range=0..200))
