# Grasshopper definition XHG.⠀⠀⠀⠀◯⠀옷ߦᗩᴥᕤᕦ⠀◯⠀ᗝᗱᗴߦᗩᙏ⠀◯⠀ᗱᗴᙁ✤ᴥᑎ✤⠀◯⠀ᗱᗴᴥᑎ✤ᗩᗯᴥᑎᑐᑕ⠀◯⠀⠀⠀⠀ⵙ⠀⠀⠀⠀◯⠀ᑐᑕᑎᴥᗯᗩ✤ᑎᴥᗱᗴ⠀◯⠀✤ᑎᴥ✤ᙁᗱᗴ⠀◯⠀ᙏᗩߦᗱᗴᗝ⠀◯⠀ᕤᕦᴥᗩߦ옷⠀◯⠀⠀⠀⠀.GHX (Grasshopper 1.0.7)
# plug-ins: Pufferfish, CurvePlus

digit_scroller = DigitScroller(Scroller_Digits=12, Scroller_Prefix="Digit Scroller", Scroller_Radix=1, Scroller_Value=1)
digit_scroller_2 = DigitScroller(Scroller_Digits=12, Scroller_Prefix="Digit Scroller", Scroller_Radix=11, Scroller_Value=50.2)
digit_scroller_3 = DigitScroller(Scroller_Digits=12, Scroller_Prefix="Digit Scroller", Scroller_Radix=1, Scroller_Value=0.00070038828)
digit_scroller_4 = DigitScroller(Scroller_Digits=12, Scroller_Prefix="Digit Scroller", Scroller_Radix=10, Scroller_Value=2)
digit_scroller_5 = DigitScroller(Scroller_Digits=12, Scroller_Prefix="Digit Scroller", Scroller_Radix=1, Scroller_Value=1)
digit_scroller_6 = DigitScroller(Scroller_Digits=12, Scroller_Prefix="Digit Scroller", Scroller_Radix=10, Scroller_Value=2)
series = Series(Start=0, Step=digit_scroller_3, Count=digit_scroller_2)
expression = Expression(
    X=series,
    O_EZIS_O_SIZE_O=digit_scroller_5,
    O_REWOP_TOOR_O_ROOT_POWER_O=digit_scroller_4,
    O_REWOP_O_POWER_O=digit_scroller_6,
    Expression="(O_EZIS_O_SIZE_O^O_REWOP_O_POWER_O-abs(X-1)^O_REWOP_O_POWER_O)^(1/O_REWOP_TOOR_O_ROOT_POWER_O)")
dup = DuplicateData(Data=digit_scroller, Number=digit_scroller_2, Order=True)
expression_2 = Expression(X=series, Expression="asin((x-.5)*2)/(2*atan(1))/2+.5")
graph = GraphMapper(
    series,
    x0=0,
    x1=1,
    y0=0,
    y1=1,
    A=1,
    B=0,
    container_name="Linear",
    Graph_x0=0.25,
    Graph_x1=0.75,
    Graph_y0=0.25,
    Graph_y1=0.75)
graph_2 = GraphMapper(series, x0=0, x1=0.0176, y0=0, y1=0.0625, container_name="Sine", Equation_px=[0, 1], Equation_py=[0, 1])
digit_scroller_7 = DigitScroller(Scroller_Digits=12, Scroller_Prefix="Digit Scroller", Scroller_Radix=11, Scroller_Value=1)
stream_filter = StreamFilter(Gate=digit_scroller_7, Stream0=graph, Stream1=graph_2, Stream2=expression, Stream3=expression_2)
turtle = DotNETVBScriptLEGACY(Forward=dup, Left=stream_filter)  # -> out, Points; inputs Forward: list, Left: list
# ---------- turtle: VB ----------
    Dim i As Integer
    Dim dir As New On3dVector(1, 0, 0)    
    Dim pos As New On3dVector(0, 0, 0) 
    Dim axis As New On3dVector(0, 0, 1)
    Dim pnts As New List(Of On3dVector)

    pnts.Add(pos)
    
    For i = 0 To Forward.Count() - 1
      Dim P As New On3dVector
      dir.Rotate(Left(i), axis)      
      P = dir * Forward(i) + pnts(i)
      pnts.Add(P)
    Next
    
    Points = pnts
# ---------- end turtle ----------
digit_scroller_8 = DigitScroller(Scroller_Digits=12, Scroller_Prefix="Digit Scroller", Scroller_Radix=11, Scroller_Value=11)
digit_scroller_9 = DigitScroller(Scroller_Digits=12, Scroller_Prefix="Digit Scroller", Scroller_Radix=8, Scroller_Value=0.1525)
digit_scroller_10 = DigitScroller(Scroller_Digits=12, Scroller_Prefix="Digit Scroller", Scroller_Radix=8, Scroller_Value=0.0625)
digit_scroller_11 = DigitScroller(Scroller_Digits=12, Scroller_Prefix="Digit Scroller", Scroller_Radix=1, Scroller_Value=1)
digit_scroller_12 = DigitScroller(Scroller_Digits=12, Scroller_Prefix="Digit Scroller", Scroller_Radix=11, Scroller_Value=99.2)
digit_scroller_13 = DigitScroller(Scroller_Digits=12, Scroller_Prefix="Digit Scroller", Scroller_Radix=1, Scroller_Value=0.00150038828)
intcrv = Interpolate(Vertices=turtle.Points, Degree=digit_scroller_8, Periodic=False)  # -> Curve, Length, Domain
curvature = Curvature(Curve=intcrv.Curve, Parameter=digit_scroller_2)  # -> Point, Curvature, Curvature_2
rotate = Rotate(Geometry=intcrv.Curve, Angle=3.141592654, Plane=PlaneXY(0, 0, 0))  # -> Geometry, Transform
construct_domain = ConstructDomain(DomainStart=0, DomainEnd=digit_scroller_9)
construct_domain_2 = ConstructDomain(DomainStart=0, DomainEnd=digit_scroller_10)
darc = DeconstructArc(Arc=curvature.Curvature_2)  # -> BasePlane, Radius, Angle
panel = Panel(darc.Radius)
series_2 = Series(Start=0, Step=digit_scroller_13, Count=digit_scroller_12)
dup_2 = DuplicateData(Data=digit_scroller_11, Number=digit_scroller_12, Order=True)
point_on_curve = PointOnCurve(intcrv.Curve, parameter=1)
rotate_direction = RotateDirection(Geometry=intcrv.Curve, Center=point_on_curve, From=Vector(0, -1, 0), To=Vector(0, 1, 0))  # -> Geometry, Transform
graph_3 = GraphMapper(
    series_2,
    x0=0,
    x1=1,
    y0=0,
    y1=1,
    A=1,
    B=0,
    container_name="Linear",
    Graph_x0=0.25,
    Graph_x1=0.75,
    Graph_y0=0.25,
    Graph_y1=0.75)
digit_scroller_14 = DigitScroller(Scroller_Digits=12, Scroller_Prefix="Digit Scroller", Scroller_Radix=11, Scroller_Value=1)
digit_scroller_15 = DigitScroller(Scroller_Digits=12, Scroller_Prefix="Digit Scroller", Scroller_Radix=11, Scroller_Value=115)
join_curves = JoinCurves(Curves=[rotate_direction.Geometry, intcrv.Curve], Preserve=False)
bounding_rectangle = BoundingRectangle(Geometry=join_curves, Plane=PlaneXY(0, 0, 0), unioned=True)
curve_graph_mapper = CurveGraphMapper(
    Curves=join_curves,
    Rectangle=bounding_rectangle,
    Values=series_2,
    XAxis=construct_domain,
    YAxis=construct_domain_2,
    Flip=False,
    Snap=False,
    TextSize=1)  # -> Mapped, GraphCurves, GraphPoints, ValueLines, ValuePoints, MappedLines, MappedPoints, Boundary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
turtle_2 = DotNETVBScriptLEGACY(Forward=dup_2, Left=curve_graph_mapper.Mapped)  # -> out, Points; inputs Forward: list, Left: list; same code as turtle
quick_graph = QuickGraph(curve_graph_mapper.Mapped, SortOrder=0)
quick_graph_2 = QuickGraph(curve_graph_mapper.GraphCurves, SortOrder=0)
quick_graph_3 = QuickGraph(curve_graph_mapper.GraphPoints, SortOrder=0)
quick_graph_4 = QuickGraph(curve_graph_mapper.ValueLines, SortOrder=0)
quick_graph_5 = QuickGraph(curve_graph_mapper.ValuePoints, SortOrder=0)
quick_graph_6 = QuickGraph(curve_graph_mapper.MappedLines, SortOrder=0)
quick_graph_7 = QuickGraph(curve_graph_mapper.MappedPoints, SortOrder=0)
panel_2 = Panel(curve_graph_mapper.Mapped)
point_on_curve_2 = PointOnCurve(join_curves, parameter=1)
intcrv_2 = Interpolate(Vertices=turtle_2.Points, Degree=3, Periodic=False)  # -> Curve, Length, Domain
curvature_graph = CurvatureGraph(Curve=[join_curves, intcrv_2.Curve], Density=digit_scroller_14, Scale=digit_scroller_15)
derivatives = Derivatives(Curve=[join_curves, intcrv_2.Curve], Parameter=point_on_curve_2)  # -> Point, FirstDerivative, SecondDerivative, ThirdDerivative, FourthDerivative, FifthDerivative, SixthDerivative
vector_display = VectorDisplay(
    Anchor=derivatives.Point,
    Vector=[derivatives.ThirdDerivative, derivatives.FirstDerivative, derivatives.SecondDerivative, derivatives.FourthDerivative, derivatives.FifthDerivative, derivatives.SixthDerivative])
