# Grasshopper definition XHG.⠀⠀⠀⠀◯⠀옷ߦᗩᴥᕤᕦ⠀◯⠀ᗱᗴᴥᑎ✤ᗩᗯᴥᑎᑐᑕ⠀◯⠀ᗝᗱᗴᙁⓄᴥИNᑎ⠀◯⠀⠀⠀⠀ⵙ⠀⠀⠀⠀◯⠀ᑎИNᴥⓄᙁᗱᗴᗝ⠀◯⠀ᑐᑕᑎᴥᗯᗩ✤ᑎᴥᗱᗴ⠀◯⠀ᕤᕦᴥᗩߦ옷⠀◯⠀⠀⠀⠀.GHX (Grasshopper 1.0.7)
# plug-ins: Pufferfish

number_slider = Slider(2, range=0..16)
number_slider_2 = Slider(1024, range=0..1024)
construct_domain = ConstructDomain(DomainStart=Slider(0, range=0..100), DomainEnd=number_slider)
range = Range(Domain=construct_domain, Steps=expr("x-1", number_slider_2))
range_2 = Range(Domain=construct_domain, Steps=expr("x-1", number_slider_2))
expression = Expression(X=range_2, Expression="SIN((X)*4*ATAN(1))")
construct_point = ConstructPoint(XCoordinate=range, YCoordinate=expression, ZCoordinate=0)
interpolate = Interpolate(Vertices=construct_point, Degree=3, Periodic=False, KnotStyle=0)  # -> Curve, Length, Domain
digit_scroller = DigitScroller(Scroller_Digits=12, Scroller_Prefix="Digit Scroller", Scroller_Radix=9, Scroller_Value=0.018)
horizontal_frame = HorizontalFrame(Curve=interpolate.Curve, Parameter=Slider(63, range=0..255))
text_tag_3d = TextTag3D(Location=horizontal_frame, Text="SQRT(.5^2-(X-.5)^2)", Size=digit_scroller, Colour=RGB(212, 212, 212), Justification=8)

digit_scroller_2 = DigitScroller(Scroller_Digits=12, Scroller_Prefix="Digit Scroller", Scroller_Radix=11, Scroller_Value=1024)
digit_scroller_3 = DigitScroller(Scroller_Digits=12, Scroller_Prefix="Digit Scroller", Scroller_Radix=11, Scroller_Value=89)
digit_scroller_4 = DigitScroller(Scroller_Digits=12, Scroller_Prefix="Digit Scroller", Scroller_Radix=11, Scroller_Value=1)
curve = Curve(interpolate.Curve)
curvature_graph = CurvatureGraph(Curve=interpolate.Curve, Density=digit_scroller_4, Scale=digit_scroller_3)
divide_curve = DivideCurve(Curve=curve, Count=digit_scroller_2, Kinks=False)  # -> Points, Tangents, Parameters
curve_length_at = CurveLengthAt(Curve=curve, Point=divide_curve.Points, Normalized=False)  # -> Length, Parameter
curvature = Curvature(Curve=curve, Parameter=curve_length_at.Parameter)  # -> Point, Curvature, Curvature_2
deconstruct_arc = DeconstructArc(Arc=curvature.Curvature_2)  # -> BasePlane, Radius, Angle
one_over_x = OneOverX(Value=deconstruct_arc.Radius)
bounds = Bounds(Numbers=one_over_x)
one_over_x_2 = OneOverX(Value=deconstruct_arc.Radius)
remap_numbers = RemapNumbers(Value=one_over_x_2, Source=bounds, Target=Domain(0, 1))  # -> Mapped, Clipped
reparameterize_numbers = ReparameterizeNumbers(Numbers=remap_numbers.Mapped, Invert=False)  # -> Reparameterized, Original

number_slider_3 = Slider(1, range=0..16)
number_slider_4 = Slider(1024, range=0..1024)
construct_domain_2 = ConstructDomain(DomainStart=Slider(0, range=0..100), DomainEnd=number_slider)
range_3 = Range(Domain=construct_domain_2, Steps=expr("x-1", number_slider_4))
range_4 = Range(Domain=construct_domain_2, Steps=expr("x-1", number_slider_4))
construct_point_2 = ConstructPoint(XCoordinate=range_3, YCoordinate=reparameterize_numbers.Reparameterized, ZCoordinate=0)
interpolate_2 = Interpolate(Vertices=construct_point_2, Degree=3, Periodic=False, KnotStyle=0)  # -> Curve, Length, Domain
expression_2 = Expression(X=range_4, Expression="SIN((X)*4*ATAN(1))")
digit_scroller_5 = DigitScroller(Scroller_Digits=12, Scroller_Prefix="Digit Scroller", Scroller_Radix=9, Scroller_Value=0.018)
horizontal_frame_2 = HorizontalFrame(Curve=interpolate_2.Curve, Parameter=Slider(63, range=0..255))
text_tag_3d_2 = TextTag3D(
    Location=horizontal_frame_2,
    Text="SQRT(.5^2-(X-.5)^2)",
    Size=digit_scroller_5,
    Colour=RGB(212, 212, 212),
    Justification=8)

panel = Panel(one_over_x_2)
