# Grasshopper definition XHG.⠀⠀⠀⠀ⵙߦⵙᗩⵙᙏⵙᗱᗴⵙᴥⵙ⠀◯⠀ⵙᴥⵙᗱᗴⵙ8ⵙᙏⵙᑎⵙИNⵙ⠀⠀⠀⠀◯⠀⠀⠀⠀ⵙ⠀⠀⠀⠀◯⠀⠀⠀⠀ⵙИNⵙᑎⵙᙏⵙ8ⵙᗱᗴⵙᴥⵙ⠀◯⠀ⵙᴥⵙᗱᗴⵙᙏⵙᗩⵙߦⵙ⠀⠀⠀⠀.GHX (Grasshopper 1.0.7)
# plug-ins: ExcelReadWrite

digit_scroller = DigitScroller(Scroller_Digits=12, Scroller_Prefix=" ", Scroller_Radix=11, Scroller_Value=5)
infoglasses = InfoGlasses(Run=True, Language=0, assemSet=False, cateSet=True, showPlugin=False)
series = Series(Start=0, Step=1, Count=digit_scroller)
file_path = FilePath("C:\ƧLX....⠀⠀⠀⠀ⵙ✤ᴥᗩ옷ᑐᑕⵙᗝᙁⓄ옷ᔓᔕᗱᗴᴥ옷✤ⵙ人✤ꖴᙁᗩꖴИNᗱᗴᕤᕦИNⓄᑐᑕⵙ人ᑐᑕИNᗱᗴᑎ¤ᗱᗴᴥꗳⵙ⠀⠀⠀⠀◯⠀⠀⠀⠀ⵙ⠀⠀⠀⠀◯⠀⠀⠀⠀ⵙꗳᴥᗱᗴ¤ᑎᗱᗴИNᑐᑕ人ⵙᑐᑕⓄИNᕤᕦᗱᗴИNꖴᗩᙁꖴ✤人ⵙ✤옷ᴥᗱᗴᔓᔕ옷Ⓞᙁᗝⵙᑐᑕ옷ᗩᴥ✤ⵙ⠀⠀⠀⠀....XLS")
excelstaticread = ExcelStaticRead(ExcelFile=file_path, Connect=True, SheetNum=1, DataRange="all")  # -> DataOutput, Message
explode_tree = ExplodeTree(Data=excelstaticread.DataOutput)
cull_index = CullIndex(List=explode_tree, Indices=series, Wrap=False)
panel = Panel(cull_index)

bounds = Bounds(Numbers=panel)
panel_2 = Panel(bounds)

construct_domain = ConstructDomain(DomainStart="-99", DomainEnd="0")

remap_numbers = RemapNumbers(Value=panel, Source=bounds, Target=construct_domain)  # -> Mapped, Clipped

round = Round(Number=remap_numbers.Mapped)  # -> Nearest, Floor, Ceiling
panel_3 = Panel(round.Nearest)
