# Grasshopper definition XHG.⠀⠀⠀⠀ⵙᴥⵙᗱᗴⵙ人ⵙꗳⵙ人ⵙᴥⵙ✤ⵙᗱᗴⵙᙏⵙ人ⵙᔓᔕⵙ◯ⵙИNⵙⓄⵙꖴⵙᔓᔕⵙИNⵙᗱᗴⵙᙏⵙꖴⵙᗝⵙ◯ⵙⵈⵙ◯ⵙ人ⵙᴥⵙ✤ⵙᗱᗴⵙᙏⵙⓄⵙᗱᗴⵙᕤᕦⵙ⠀⠀⠀⠀◯⠀⠀⠀⠀ⵙ⠀⠀⠀⠀◯⠀⠀⠀⠀ⵙᕤᕦⵙᗱᗴⵙⓄⵙᙏⵙᗱᗴⵙ✤ⵙᴥⵙ人ⵙ◯ⵙⵈⵙ◯ⵙᗝⵙꖴⵙᙏⵙᗱᗴⵙИNⵙᔓᔕⵙꖴⵙⓄⵙИNⵙ◯ⵙᔓᔕⵙ人ⵙᙏⵙᗱᗴⵙ✤ⵙᴥⵙ人ⵙꗳⵙ人ⵙᗱᗴⵙᴥⵙ⠀⠀⠀⠀.GHX (Grasshopper 1.0.7)
# plug-ins: Pancake, Wombat, CurvePlus, Kangaroo2 Components

number_slider = Slider(10, range=0..10)
import_obj = ImportOBJ(File="C:\T888.OBJ", MapYtoZ=True, LastSaveLocalization="neutral,N")
cone = Cone(Base=PlaneYZ(0, 0, 0), Radius=20, Length=80)  # -> Cone, Tip
construct_point = ConstructPoint(XCoordinate=0, YCoordinate=0, ZCoordinate=0)
division = Division(A=number_slider, B="3")
ⵙ人ⵙᴥⵙ_ⵙᗱᗴⵙᙏⵙ_ⵙᗱᗴⵙᕤᕦⵙ_ⵙ_ⵙᕤᕦⵙᗱᗴⵙ_ⵙᙏⵙᗱᗴⵙ_ⵙᴥ = Slider(1, range=0..1)  # "ⵙ人ⵙᴥⵙ✤ⵙᗱᗴⵙᙏⵙⓄⵙᗱᗴⵙᕤᕦⵙ◯ⵙ◯ⵙᕤᕦⵙᗱᗴⵙⓄⵙᙏⵙᗱᗴⵙ✤ⵙᴥⵙ人ⵙ"
ⵙꕤⵙ_ⵙᴥⵙ_ⵙᴥⵙꖴⵙᙏⵙ_ⵙ_ⵙᙏⵙꖴⵙᴥⵙ_ⵙᴥⵙ_ⵙꕤⵙ = Slider(1, range=0..1)
ⵙꕤⵙ_ⵙ8ⵙ_ⵙᕤᕦⵙиnⵙꖴⵙᗝⵙиnⵙᑎⵙ_ⵙ8ⵙ_ⵙ_ⵙ8ⵙ_ⵙᑎⵙиn = Slider(1, range=0..1)  # "ⵙꕤⵙⓄⵙ8ⵙ◯ⵙᕤᕦⵙИNⵙꖴⵙᗝⵙИNⵙᑎⵙⓄⵙ8ⵙ◯ⵙ◯ⵙ8ⵙⓄⵙᑎⵙИNⵙᗝⵙꖴⵙИNⵙᕤᕦⵙ◯ⵙ8ⵙⓄⵙꕤ"
division_2 = Division(A=number_slider, B="9")
multiplication = Multiplication(A=number_slider, B="sqrt(3)")
spiral = Spiral(
    BasePlane=Plane(origin=(0, 0, 0), x=(0, 1, 0), y=(-1, 0, 0)),
    Angle=31.41592654,
    Turns=division_2,
    BaseRadius=multiplication,
    PeakRadius=division)
pipe = Pipe(Curve=spiral, Radius=number_slider, Caps=2)
multipipe = MultiPipe(
    Curves=spiral,
    NodeSize=division_2,
    EndOffset=division,
    StrutSize=division_2,
    Segment=0,
    KinkAngle=0.6,
    CubeFit=0,
    Caps=1)
stream_filter = StreamFilter(Gate=Slider(2, range=0..2), Stream0=import_obj, Stream1=cone.Cone, Stream2=multipipe)
geometry = Geometry(stream_filter)
bounding_box = BoundingBox(Content=geometry, Plane=PlaneXY(0, 0, 0), UnionBox=True)  # -> Box, Box_2
center_geometry_at_origin = CenterGeometryAtOrigin(Geometry=bounding_box.Box)  # -> RecenteredGeometry, TranslationVector
stream_filter_2 = StreamFilter(Gate=ⵙ人ⵙᴥⵙ_ⵙᗱᗴⵙᙏⵙ_ⵙᗱᗴⵙᕤᕦⵙ_ⵙ_ⵙᕤᕦⵙᗱᗴⵙ_ⵙᙏⵙᗱᗴⵙ_ⵙᴥ, Stream1=geometry)
stream_filter_3 = StreamFilter(Gate=ⵙꕤⵙ_ⵙ8ⵙ_ⵙᕤᕦⵙиnⵙꖴⵙᗝⵙиnⵙᑎⵙ_ⵙ8ⵙ_ⵙ_ⵙ8ⵙ_ⵙᑎⵙиn, Stream1=bounding_box.Box)
move = Move(Geometry=[stream_filter_2, stream_filter_3], Motion=center_geometry_at_origin.TranslationVector)  # -> Geometry, Transform
bounding_box_2 = BoundingBox(Content=move.Geometry, Plane=PlaneXY(0, 0, 0), UnionBox=True)  # -> Box, Box_2
geometry_2 = Geometry(move.Geometry)
deconstruct_box = DeconstructBox(Box=bounding_box_2.Box)  # -> Plane, X, Y, Z
deconstruct_domain = DeconstructDomain(Domain=deconstruct_box.Y)  # -> Start, End
deconstruct_domain_2 = DeconstructDomain(Domain=deconstruct_box.Z)  # -> Start, End
deconstruct_domain_3 = DeconstructDomain(Domain=deconstruct_box.X)  # -> Start, End

multiplication_2 = Multiplication(A=deconstruct_domain_3.Start, B=3)
multiplication_3 = Multiplication(A=deconstruct_domain.Start, B="3")
addition = Addition(A=multiplication_2, B=multiplication_3)

multiplication_4 = Multiplication(A=deconstruct_domain_3.Start, B="6")
multiplication_5 = Multiplication(A=deconstruct_domain.Start, B="12")
addition_2 = Addition(A=multiplication_5, B=multiplication_4)
multiplication_6 = Multiplication(A=deconstruct_domain_3.Start, B="2")
division_3 = Division(A=addition_2, B=2)
addition_3 = Addition(A=deconstruct_domain_2.Start, B=division_3)
vector_xyz = VectorXYZ(XComponent=multiplication_6, YComponent=addition, ZComponent=addition_3)  # -> Vector, Length
move_2 = Move(Geometry=geometry_2, Motion=vector_xyz.Vector)  # -> Geometry, Transform
mirror = Mirror(Geometry=move_2.Geometry, Plane=PlaneYZ(0, 0, 0))  # -> Geometry, Transform

multiplication_7 = Multiplication(A=deconstruct_domain.Start, B="3")
addition_4 = Addition(A=deconstruct_domain_3.Start, B=multiplication_7)
addition_5 = Addition(A=addition_4, B=deconstruct_domain_2.Start)
addition_6 = Addition(A=multiplication_7, B=addition_5)

vector_xyz_2 = VectorXYZ(XComponent=0, YComponent=addition_4, ZComponent=addition_6)  # -> Vector, Length
move_3 = Move(Geometry=geometry_2, Motion=vector_xyz_2.Vector)  # -> Geometry, Transform

stream_filter_4 = StreamFilter(Gate=ⵙꕤⵙ_ⵙᴥⵙ_ⵙᴥⵙꖴⵙᙏⵙ_ⵙ_ⵙᙏⵙꖴⵙᴥⵙ_ⵙᴥⵙ_ⵙꕤⵙ, Stream0=move_3.Geometry, Stream1=[move_2.Geometry, mirror.Geometry])

polar_array = PolarArray(Geometry=stream_filter_4, Plane=PlaneXY(0, 0, 0), Count=4, Angle=6.283185307)  # -> Geometry, Transform
rotate = Rotate(Geometry=polar_array.Geometry, Angle=1.570796327, Plane=PlaneYZ(0, 0, 0))  # -> Geometry, Transform
polar_array_2 = PolarArray(Geometry=polar_array.Geometry, Plane=Plane(origin=(0, 0, 0), x=(0, 0, 1), y=(1, 0, 0)), Count=4, Angle=6.283185307)  # -> Geometry, Transform
rotate_2 = Rotate(Geometry=polar_array.Geometry, Angle=1.570796327, Plane=Plane(origin=(0, 0, 0), x=(0, -1, 0), y=(0, 0, 1)))  # -> Geometry, Transform

geometry_3 = Geometry([polar_array_2.Geometry, rotate.Geometry, rotate_2.Geometry])
