# Grasshopper definition XHG.⠀⠀⠀⠀ⵙᴥⵙᗱᗴⵙ人ⵙꗳⵙ人ⵙᴥⵙ✤ⵙᗱᗴⵙᙏⵙ人ⵙᔓᔕⵙ◯ⵙᕤᕦⵙИNⵙꖴⵙ옷ⵙᔓᔕⵙᗱᗴⵙᙏⵙ◯ⵙ✤ⵙᴥⵙᗩⵙߦⵙ◯ⵙ∷ⵙ꞉ⵙ⠀⠀⠀⠀◯⠀⠀⠀⠀ⵙ⠀⠀⠀⠀◯⠀⠀⠀⠀ⵙ꞉ⵙ∷ⵙ◯ⵙߦⵙᗩⵙᴥⵙ✤ⵙ◯ⵙᙏⵙᗱᗴⵙᔓᔕⵙ옷ⵙꖴⵙИNⵙᕤᕦⵙ◯ⵙᔓᔕⵙ人ⵙᙏⵙᗱᗴⵙ✤ⵙᴥⵙ人ⵙꗳⵙ人ⵙᗱᗴⵙᴥⵙ⠀⠀⠀⠀.GHX (Grasshopper 1.0.7)
# plug-ins: Pancake

# ---- group: ⠀⠀⠀⠀ⵙ⠀ᗱᗴ⠀ⵙ⠀ᙁ⠀ⵙ⠀✻⠀ⵙ⠀ᑐᑕ⠀ⵙ⠀ᗱᗴ⠀ⵙ⠀ߦ⠀ⵙ⠀ᔓᔕ⠀ⵙ⠀⠀⠀⠀◯⠀⠀⠀⠀ⵙ⠀⠀⠀⠀◯⠀⠀⠀⠀ⵙ⠀ᔓᔕ⠀ⵙ⠀ߦ⠀ⵙ⠀ᗱᗴ⠀ⵙ⠀ᑐᑕ⠀ⵙ⠀✻⠀ⵙ⠀ᙁ⠀ⵙ⠀ᗱᗴ⠀ⵙ⠀⠀⠀⠀
panel = Panel("1.40625*8")
panel_2 = Panel("9^-7*7257.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")

# ----
import_from = ImportFrom(LastSaveLocalization="neutral,N")  # -> Geo, Layer, ObjectAttributes
xy_plane = XYPlane(Origin=Point(0, 0, 0))
xz_plane = XZPlane(Origin=Point(0, 0, 0))
yz_plane = YZPlane(Origin=Point(0, 0, 0))

# ---- group: ⠀⠀⠀⠀ⵙ⠀✤⠀ⵙ⠀Ⓞ⠀ⵙ⠀옷⠀ⵙ⠀ᔓᔕ⠀ⵙ⠀人⠀ⵙ⠀ᗱᗴ⠀ⵙ⠀✻⠀ⵙ⠀⠀⠀⠀◯⠀⠀⠀⠀ⵙ⠀⠀⠀⠀◯⠀⠀⠀⠀ⵙ⠀✻⠀ⵙ⠀ᗱᗴ⠀ⵙ⠀人⠀ⵙ⠀ᔓᔕ⠀ⵙ⠀옷⠀ⵙ⠀Ⓞ⠀ⵙ⠀✤⠀ⵙ⠀⠀⠀⠀
panel_3 = Panel("1.40625*1.796875")
panel_4 = Panel("9^-3.203125*7257.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")

# ----
geometry = Geometry()
number = Number(panel_2)
settings_custom = SettingsCustom(
    StitchSeams=True,
    SimplePlanes=True,
    Refine=True,
    MinCount=0,
    MaxCount=0,
    AspectRatio=0,
    MaxDistance=0,
    MaxAngle="0",
    MinEdge="0",
    MaxEdge=0)
radians = Radians(Degrees="135")
rotate_axis = RotateAxis(Geometry=yz_plane, Angle=0.7853981634, Axis=Line((0, 0, 0), (0, 1793.125, 0)))  # -> Geometry, Transform
rotate_axis_2 = RotateAxis(Geometry=yz_plane, Angle=radians, Axis=Line((0, 0, 0), (0, 0, 2241.375)))  # -> Geometry, Transform
import_obj = ImportOBJ(MapYtoZ=False, LastSaveLocalization="neutral,N")
mesh_brep = MeshBrep(Brep=geometry, Settings=settings_custom)
mesh = Mesh(import_obj)
panel_5 = Panel(mesh)
mirror = Mirror(Geometry=mesh, Plane=[rotate_axis.Geometry, rotate_axis_2.Geometry])  # -> Geometry, Transform
mesh_join = MeshJoin(Meshes=[mesh, mirror.Geometry])
mirror_2 = Mirror(Geometry=mesh_join, Plane=xz_plane)  # -> Geometry, Transform
export_as = ExportAs(Geometry=mesh, Overwrite=False, Export=False, CompMode=False, LastSaveLocalization="neutral,N")  # -> OK, ExportCommand
mesh_join_2 = MeshJoin(Meshes=[mesh_join, mirror_2.Geometry])
mirror_3 = Mirror(Geometry=mesh_join_2, Plane=xy_plane)  # -> Geometry, Transform
mesh_join_3 = MeshJoin(Meshes=[mirror_3.Geometry, mesh_join_2])
mirror_4 = Mirror(Geometry=mesh_join_3, Plane=yz_plane)  # -> Geometry, Transform
mesh_join_4 = MeshJoin(Meshes=[mesh_join_3, mirror_4.Geometry])
mesh_2 = Mesh(mesh_join_4)
panel_6 = Panel(mesh_2)
