# Grasshopper definition XHG.⠀⠀⠀⠀ⵙ⠀ᗱᗴ⠀ⵙ⠀ᴥ⠀ⵙ⠀ᗱᗴ⠀ⵙ⠀옷⠀ⵙ⠀ߦ⠀ⵙ⠀ᔓᔕ⠀ⵙ⠀⠀◯⠀⠀ⵙ⠀ИN⠀ⵙ⠀Ⓞ⠀ⵙ⠀⠀◯⠀⠀ⵙ⠀ИN⠀ⵙ⠀Ⓞ⠀ⵙ⠀ꖴ⠀ⵙ⠀✤⠀ⵙ⠀ᑐᑕ⠀ⵙ⠀ᗱᗴ⠀ⵙ⠀ᒍᒐ⠀ⵙ⠀Ⓞ⠀ⵙ⠀ᴥ⠀ⵙ⠀ߦ⠀ⵙ⠀⠀⠀⠀◯⠀⠀⠀⠀ⵙ⠀⠀⠀⠀◯⠀⠀⠀⠀ⵙ⠀ߦ⠀ⵙ⠀ᴥ⠀ⵙ⠀Ⓞ⠀ⵙ⠀ᒍᒐ⠀ⵙ⠀ᗱᗴ⠀ⵙ⠀ᑐᑕ⠀ⵙ⠀✤⠀ⵙ⠀ꖴ⠀ⵙ⠀Ⓞ⠀ⵙ⠀ИN⠀ⵙ⠀⠀◯⠀⠀ⵙ⠀Ⓞ⠀ⵙ⠀ИN⠀ⵙ⠀⠀◯⠀⠀ⵙ⠀ᔓᔕ⠀ⵙ⠀ߦ⠀ⵙ⠀옷⠀ⵙ⠀ᗱᗴ⠀ⵙ⠀ᴥ⠀ⵙ⠀ᗱᗴ⠀ⵙ⠀⠀⠀⠀.GHX (Grasshopper 1.0.7)
# plug-ins: Heteroptera, Pufferfish, BullAnt, RichedGraphMapper

digit_scroller = DigitScroller(Scroller_Digits=12, Scroller_Prefix="Digit Scroller", Scroller_Radix=1, Scroller_Value=0.007)
digit_scroller_2 = DigitScroller(Scroller_Digits=12, Scroller_Prefix="Digit Scroller", Scroller_Radix=1, Scroller_Value=0.005)
digit_scroller_3 = DigitScroller(Scroller_Digits=12, Scroller_Prefix="Digit Scroller", Scroller_Radix=1, Scroller_Value=0.001)
digit_scroller_4 = DigitScroller(Scroller_Digits=12, Scroller_Prefix="Digit Scroller", Scroller_Radix=1, Scroller_Value=1)
digit_scroller_5 = DigitScroller(Scroller_Digits=12, Scroller_Prefix="Digit Scroller", Scroller_Radix=1, Scroller_Value=0.16388)
digit_scroller_6 = DigitScroller(Scroller_Digits=12, Scroller_Prefix="Digit Scroller", Scroller_Radix=1, Scroller_Value=0.02398)
digit_scroller_7 = DigitScroller(Scroller_Digits=12, Scroller_Prefix="Digit Scroller", Scroller_Radix=1, Scroller_Value=0.006)
digit_scroller_8 = DigitScroller(Scroller_Digits=12, Scroller_Prefix="Digit Scroller", Scroller_Radix=1, Scroller_Value=0.004)
digit_scroller_9 = DigitScroller(Scroller_Digits=12, Scroller_Prefix="Digit Scroller", Scroller_Radix=1, Scroller_Value=0.003)
digit_scroller_10 = DigitScroller(Scroller_Digits=12, Scroller_Prefix="Digit Scroller", Scroller_Radix=1, Scroller_Value=0.002)
digit_scroller_11 = DigitScroller(Scroller_Digits=12, Scroller_Prefix="Digit Scroller", Scroller_Radix=1, Scroller_Value=0)
digit_scroller_12 = DigitScroller(Scroller_Digits=12, Scroller_Prefix=" ", Scroller_Radix=11, Scroller_Value=16)
digit_scroller_13 = DigitScroller(Scroller_Digits=12, Scroller_Prefix=" ", Scroller_Radix=1, Scroller_Value=1.111)
digit_scroller_14 = DigitScroller(Scroller_Digits=12, Scroller_Prefix=" ", Scroller_Radix=1, Scroller_Value=1)
merge = Merge(
    Data1=digit_scroller_4,
    Data2=digit_scroller_5,
    Data3=digit_scroller_6,
    Data4=digit_scroller,
    Data5=digit_scroller_7,
    Data6=digit_scroller_2,
    Data7=digit_scroller_8,
    Data8=digit_scroller_9,
    Data9=digit_scroller_10,
    Data10=digit_scroller_3,
    Data11=digit_scroller_11)
panel = Panel("(2*sqrt(2)+1)")
panel_2 = Panel("1.5")
digit_scroller_15 = DigitScroller(Scroller_Digits=12, Scroller_Prefix=" ", Scroller_Radix=1, Scroller_Value=3.828427125)
division = Division(A=digit_scroller_13, B=digit_scroller_14)
multiplication = Multiplication(A=digit_scroller_12, B=digit_scroller_14)
digit_scroller_16 = DigitScroller(Scroller_Digits=12, Scroller_Prefix=" ", Scroller_Radix=1, Scroller_Value=0.5)
number = Number(division)
number_slider = Slider(0.6, range=0..4)
concatenate = Concatenate(FragmentA="[N-1]/", FragmentB=number)
plane_surface = PlaneSurface(Plane=PlaneXY(0, 0, 1), XSize=Domain(-1, 1), YSize=Domain(-1, 1))
center = Center(Geometric=plane_surface, forall=True, referenceAll=0)  # -> Center, Dimension
range = Range(Domain=Domain(1e-10, 1), Steps=multiplication)  # -> reverse(Range)
expression = Expression(X=range, O=digit_scroller_16, Expression="abs((x+1)^-abs(O*10))")  # -> reverse(Result); disabled
rectangle = Rectangle(plane_surface)
digit_scroller_17 = DigitScroller(Scroller_Digits=12, Scroller_Prefix="Digit Scroller", Scroller_Radix=9, Scroller_Value=4)
power = Power(A=2, B=digit_scroller_17)
multiplication_2 = Multiplication(A=1, B=power)
sequence = Sequence(Notation=concatenate, Length=expr("X+1", multiplication), Initial=multiplication_2)
division_2 = Division(A=sequence, B=power)
multiplication_3 = Multiplication(A=division_2, B=power)

digit_scroller_18 = DigitScroller(Scroller_Digits=12, Scroller_Prefix=" ", Scroller_Radix=1, Scroller_Value=2)
expression_2 = Expression(X=division_2, O=digit_scroller_18, Expression="(1-ABS(X-1)^O)^(((1)/(O)))")
digit_scroller_19 = DigitScroller(Scroller_Digits=12, Scroller_Prefix=" ", Scroller_Radix=1, Scroller_Value=2)
expression_3 = Expression(X=division_2, O=digit_scroller_19, Expression="1-(1-ABS(X-0)^O)^(((1)/(O)))")
digit_scroller_20 = DigitScroller(Scroller_Digits=12, Scroller_Prefix=" ", Scroller_Radix=1, Scroller_Value=2)
digit_scroller_21 = DigitScroller(Scroller_Digits=12, Scroller_Prefix=" ", Scroller_Radix=1, Scroller_Value=0.538)
number_slider_2 = Slider(1.531241, range=0..4)
number_slider_3 = Slider(0.475133, range=0..4)
quick_graph = QuickGraph(expression_3, SortOrder=0)

division_3 = Division(A=expression_3, B=power)
panel_3 = Panel(division_2)

list_length = ListLength(List=division_2)
insert_items = InsertItems(List=division_2, Item=1e-10, Indices=list_length, Wrap=False)

stream_filter = StreamFilter(Gate=Slider(1, range=0..1), Stream0=division_2, Stream1=insert_items)

multiplication_4 = Multiplication(A=expression_3, B=power)
bounds = Bounds(Numbers=multiplication_4)
rich_graph_mapper = RichGraphMapper(
    Values=multiplication_4,
    Source=bounds,
    Target=bounds,
    Remap=False,
    x0=0.2779901343,
    x1=16,
    y0=0.2779901343,
    y1=16,
    Cx=0.5,
    Cy=0.5,
    container_name="Conic")
division_4 = Division(A=rich_graph_mapper, B=power)

panel_4 = Panel(insert_items)
construct_domain = ConstructDomain(DomainStart=expr("-X", stream_filter), DomainEnd=stream_filter)
rectangle_2 = Rectangle(Plane=PlaneXY(0, 0, 1), XSize=construct_domain, YSize=construct_domain, Radius=0)  # -> graft(Rectangle), Length
scale = Scale(Geometry=rectangle_2.Rectangle, Center=Point(0, 0, 0), Factor=expr("2^X", digit_scroller_17))  # -> Geometry, Transform
quick_graph_2 = QuickGraph(stream_filter, SortOrder=0)

expression_4 = Expression(X=range, O=Slider(2.4, range=0..4), Expression="1-(1-ABS(X-0)^O)^(((1)/(O)))")
expression_5 = Expression(X=range, O=Slider(0.1, range=0..4), Expression="(1-ABS(X-1)^O)^(((1)/(O)))")

arc = Arc(Plane=PlaneXY(1, 0.5, 0), Radius=0.5, Angle=Domain(1.570796327, 3.141592654))  # -> Arc, Length
arc_2 = Arc(Plane=Plane(origin=(0, 0.5, 0), x=(-1, 0, 0), y=(0, -1, 0)), Radius=0.5, Angle=Domain(1.570796327, 3.141592654))  # -> Arc, Length
divide_curve = DivideCurve(Curve=scale.Geometry, Count=expr("X*4", multiplication), Kinks=False)  # -> Points, Tangents, Parameters

digit_scroller_22 = DigitScroller(Scroller_Digits=12, Scroller_Prefix=" ", Scroller_Radix=1, Scroller_Value=0.538)
expression_6 = Expression(X=range, O=Slider(2, range=0..4), Expression="(1-ABS(X-1)^O)^(((1)/(O)))")

digit_scroller_23 = DigitScroller(Scroller_Digits=12, Scroller_Prefix=" ", Scroller_Radix=1, Scroller_Value=0.718282)
digit_scroller_24 = DigitScroller(Scroller_Digits=12, Scroller_Prefix=" ", Scroller_Radix=1, Scroller_Value=0.718282)
digit_scroller_25 = DigitScroller(Scroller_Digits=12, Scroller_Prefix=" ", Scroller_Radix=1, Scroller_Value=0.538)
expression_7 = Expression(X=range, O=Slider(2, range=0..4), Expression="1-(1-ABS(X-0)^O)^(((1)/(O)))")
expression_8 = Expression(X=range, O=Slider(2, range=0..4), Expression="(1-ABS(X-1)^O)^(((1)/(O)))")

scale_2 = Scale(Geometry=divide_curve.Points, Center=Point(0, 0, 0), Factor=expr("1/2^X", digit_scroller_17))  # -> Geometry, Transform
join_curves = JoinCurves(Curves=[arc_2.Arc, arc.Arc], Preserve=False)
line_sdl = LineSDL(Start=Point(0, 0, 0), Direction=Vector(1, 1, 0), Length=1.414213562)
mirror = Mirror(Geometry=join_curves, Plane=Plane(origin=(0, 0, 0), x=(0, 0, 1), y=(0.7071067812, 0.7071067812, 0)))  # -> Geometry, Transform
expression_9 = Expression(X=range, Expression="asin(((x-.5)*2))/PI+.5")
expression_10 = Expression(X=range, Expression="-cos(((x*PI)))/2+.5")
flip_matrix = FlipMatrix(Data=scale_2.Geometry)
number_slider_4 = Slider(0.6, range=0..1)
panel_5 = Panel(flip_matrix)
construct_point = ConstructPoint(XCoordinate=range, YCoordinate=expression_8, ZCoordinate=0)
quad_sphere = QuadSphere(Base=PlaneXY(0, 0, 0), Radius=1)
deconstruct_brep = DeconstructBrep(Brep=quad_sphere)  # -> Faces, Edges, Vertices
quick_graph_3 = QuickGraph(expression_8, SortOrder=0)
interpolate = Interpolate(Vertices=flip_matrix, Degree=3, Periodic=False, KnotStyle=1)  # -> Curve, Length, Domain
list_item = ListItem(List=deconstruct_brep.Faces, Index=0, Wrap=False)
construct_point_2 = ConstructPoint(XCoordinate=range, YCoordinate=expression_9, ZCoordinate=0)
digit_scroller_26 = DigitScroller(Scroller_Digits=12, Scroller_Prefix="Digit Scroller", Scroller_Radix=9, Scroller_Value=16)
expression_11 = Expression(X=expression_2, Expression="-cos(((x*PI)))/2+.5")
point = Point(Point(0, 0, 0))
number_slider_5 = Slider(1, range=0..2)
interpolate_2 = Interpolate(Vertices=construct_point, Degree=3, Periodic=False, KnotStyle=1)  # -> Curve, Length, Domain
interpolate_3 = Interpolate(Vertices=construct_point_2, Degree=3, Periodic=False, KnotStyle=1)  # -> Curve, Length, Domain
scale_3 = Scale(Geometry=construct_point, Center=Point(0, 0, 0), Factor=0.5)  # -> reverse(Geometry), Transform
mirror_2 = Mirror(Geometry=scale_3.Geometry, Plane=Plane(origin=(0, 0, 0), x=(0, 0, 1), y=(0.7071067812, 0.7071067812, 0)))  # -> Geometry, Transform
move = Move(Geometry=mirror_2.Geometry, Motion=Vector(0.5, 0.5, 0))  # -> Geometry, Transform
scale_4 = Scale(Geometry=scale_3.Geometry, Center=Point(0, 0, 0), Factor=number_slider_5)  # -> Geometry, Transform
scale_5 = Scale(Geometry=move.Geometry, Center=Point(0, 0, 0), Factor=expr("2-X", number_slider_5))  # -> Geometry, Transform
list_item_2 = ListItem(List=reverse(scale_4.Geometry), Index=0, Wrap=False)

multiplication_5 = Multiplication(A=division_2, B=power)
bounds_2 = Bounds(Numbers=multiplication_5)
rich_graph_mapper_2 = RichGraphMapper(
    Values=multiplication_5,
    Source=bounds_2,
    Target=bounds_2,
    Remap=False,
    x0=2.969580068,
    x1=16,
    y0=2.969580068,
    y1=16,
    Cx=1,
    Cy=0,
    container_name="Conic")
division_5 = Division(A=rich_graph_mapper_2, B=power)

list_item_3 = ListItem(List=scale_5.Geometry, Index=0, Wrap=False)
number_2 = Number(1.525878906e-05)
scale_6 = Scale(Geometry=list_item, Center=Point(0, 0, 0), Factor=expr("2^X", digit_scroller_17))  # -> Geometry, Transform
scale_7 = Scale(Geometry=interpolate.Curve, Center=Point(0, 0, 0), Factor=expr("2^X", digit_scroller_17))  # -> Geometry, Transform
scale_8 = Scale(Geometry=list_item, Center=Point(0, 0, 0), Factor=expr("2^X", digit_scroller_17))  # -> Geometry, Transform
extrude_point = ExtrudePoint(Base=interpolate.Curve, Point=point)  # disabled
dot_display = DotDisplay(Point=list_item_2, Colour=RGB(0, 0, 0), Size=0.0625)  # disabled
vector_2pt = Vector2Pt(PointA=list_item_3, PointB=list_item_2, Unitize=False)  # -> Vector, Length
move_2 = Move(Geometry=scale_5.Geometry, Motion=vector_2pt.Vector)  # -> Geometry, Transform
pull_curve = PullCurve(Curve=scale_7.Geometry, Surface=scale_8.Geometry)
digit_scroller_27 = DigitScroller(Scroller_Digits=12, Scroller_Prefix="Digit Scroller", Scroller_Radix=9, Scroller_Value=0)
number_3 = Number(multiplication)
digit_scroller_28 = DigitScroller(Scroller_Digits=12, Scroller_Prefix="Digit Scroller", Scroller_Radix=11, Scroller_Value=288)
scale_9 = Scale(Geometry=pull_curve, Center=Point(0, 0, 0), Factor=expr("1/2^X", digit_scroller_17))  # -> Geometry, Transform
brep_brep = BrepBrep(BrepA=extrude_point, BrepB=list_item)  # -> Curves, Points
merge_2 = Merge(Data1=scale_4.Geometry, Data2=move_2.Geometry)
curve = Curve(scale_9.Geometry)
plane_surface_2 = PlaneSurface(Plane=PlaneXY(0, 0, 0), XSize=Domain(-1, 1), YSize=Domain(-1, 1))
digit_scroller_29 = DigitScroller(Scroller_Digits=12, Scroller_Prefix="Digit Scroller", Scroller_Radix=11, Scroller_Value=83)
cull_duplicates = CullDuplicates(Points=merge_2, Tolerance=0.00390625, CullMode=1)  # -> Points, Indices, Valence
interpolate_4 = Interpolate(Vertices=cull_duplicates.Points, Degree=3, Periodic=False, KnotStyle=1)  # -> Curve, Length, Domain
curve_2 = Curve(interpolate_4.Curve)
scale_10 = Scale(Geometry=curve_2, Center=Point(0, 0, 0), Factor=expr("2^X", digit_scroller_26))  # -> Geometry, Transform
end_points = EndPoints(Curve=scale_10.Geometry)  # -> Start, End
rectangle_2pt = Rectangle2Pt(Plane=PlaneXY(0, 0, 0), PointA=end_points.Start, PointB=end_points.End, Radius=0)  # -> Rectangle, Length
graphmapper = GraphMapper(Curve=scale_10.Geometry, Boundary=rectangle_2pt.Rectangle, Numbers=range, bobo=True)
digit_scroller_30 = DigitScroller(Scroller_Digits=12, Scroller_Prefix="Digit Scroller", Scroller_Radix=11, Scroller_Value=13)
center_box = CenterBox(Base=PlaneXY(1, 0, 0), X=1, Y=1, Z=1)  # disabled
mesh_box = MeshBox(Base=center_box, XCount=1, YCount=1, ZCount=1)  # disabled
plane_surface_3 = PlaneSurface(Plane=PlaneYZ(0, 0, 0), XSize=Domain(-10, 10), YSize=Domain(-10, 10))
mesh_plane = MeshPlane(Boundary=plane_surface_3, WidthCount=10, HeightCount=10)  # -> Mesh, Area; disabled

graphmapper_2 = GraphMapper(Curve=scale_10.Geometry, Boundary=rectangle_2pt.Rectangle, Numbers=range, bobo=True)

digit_scroller_31 = DigitScroller(Scroller_Digits=12, Scroller_Prefix=" ", Scroller_Radix=1, Scroller_Value=2)
expression_12 = Expression(X=division_2, O=digit_scroller_31, Expression="(1-ABS(X-1)^O)^(((1)/(O)))")
digit_scroller_32 = DigitScroller(Scroller_Digits=12, Scroller_Prefix=" ", Scroller_Radix=1, Scroller_Value=1.5)
expression_13 = Expression(X=division_2, O=digit_scroller_32, Expression="1-(1-ABS(X-0)^O)^(((1)/(O)))")
digit_scroller_33 = DigitScroller(Scroller_Digits=12, Scroller_Prefix=" ", Scroller_Radix=1, Scroller_Value=2)
digit_scroller_34 = DigitScroller(Scroller_Digits=12, Scroller_Prefix=" ", Scroller_Radix=1, Scroller_Value=0.538)
number_slider_6 = Slider(1.531241, range=0..4)
number_slider_7 = Slider(0.475133, range=0..4)

number_4 = Number(expression_13)
stream_filter_2 = StreamFilter(Gate=Slider(1, range=0..3), Stream0=number_2, Stream1=graphmapper_2, Stream2=division_5, Stream3=number_4)  # -> reverse(Stream)

quick_graph_4 = QuickGraph(number_4, SortOrder=0)

prude_curve = PrudeCurve(Curve=rectangle_2.Rectangle, Length=graft(stream_filter_2), BlendType=1, Bulge=0.5)  # -> Prude, ResultBoolean
prude_curve_2 = PrudeCurve(Curve=rectangle_2.Rectangle, Length=graft(stream_filter_2), BlendType=0, Bulge=Slider(0.4, range=0..1))  # -> Prude, ResultBoolean

scale_11 = Scale(Geometry=prude_curve.Prude, Center=Point(0, 0, 0), Factor=expr("2^X", digit_scroller_17))  # -> Geometry, Transform
curve_3 = Curve([interpolate.Curve, prude_curve.Prude])
pull_curve_2 = PullCurve(Curve=scale_11.Geometry, Surface=scale_6.Geometry)
scale_12 = Scale(Geometry=pull_curve_2, Center=Point(0, 0, 0), Factor=expr("1/2^X", digit_scroller_17))  # -> Geometry, Transform
merge_3 = Merge(Data1=interpolate.Curve, Data2=prude_curve.Prude)
curve_4 = Curve(scale_12.Geometry)
merge_4 = Merge(Data1=curve, Data2=curve_4)
curve_curve = CurveCurve(CurveA=flatten(curve), CurveB=curve_4)  # -> Points, ParamsA, ParamsB; disabled
curve_5 = Curve(merge_4)
curvature_graph = CurvatureGraph(Curve=pull_curve_2, Density=1, Scale=digit_scroller_29)  # disabled
merge_5 = Merge(Data1=curve, Data2=curve_4)  # disabled
curve_6 = Curve(curve_5)
scale_13 = Scale(Geometry=curve_6, Center=Point(0, 0, 0), Factor=expr("2^X", digit_scroller_27))  # -> Geometry, Transform
divide_curves_on_intersects = DivideCurvesOnIntersects(Curves=flatten(scale_13.Geometry), Tolerance=0)
ggcurvessplitintersect = GgCurvesSplitIntersect(Curves=flatten(scale_13.Geometry), Tol=0, SplitPoly=False)  # -> flatten(Curves); disabled
scale_14 = Scale(Geometry=divide_curves_on_intersects, Center=Point(0, 0, 0), Factor=expr("1/2^X", digit_scroller_27))  # -> Geometry, Transform
list_item_4 = ListItem(List=scale_14.Geometry, Index=digit_scroller_28, Wrap=False)
list_item_5 = ListItem(List=scale_14.Geometry, Index=expr("X+1", digit_scroller_28), Wrap=False)
project = Project(Curve=list_item_4, Brep=plane_surface_2, Direction=Vector(0, 0, 1))
project_2 = Project(Curve=list_item_5, Brep=plane_surface_2, Direction=Vector(0, 0, 1))
ggnetworkpolygons = GgNetworkPolygons(Curves=scale_14.Geometry, PerimOrVoid=4)
list_item_6 = ListItem(List=scale_14.Geometry, Index=digit_scroller_28, Wrap=False)  # -> Item, Item1, Item2, Item3, Item4, Item5, Item6, Item7
mirror_3 = Mirror(Geometry=ggnetworkpolygons, Plane=PlaneXY(0, 0, 0))  # -> Geometry, Transform
project_3 = Project(
    Curve=[list_item_6.Item, list_item_6.Item1, list_item_6.Item2, list_item_6.Item3, list_item_6.Item4, list_item_6.Item5, list_item_6.Item6, list_item_6.Item7],
    Brep=plane_surface_2,
    Direction=Vector(0, 0, 1))  # -> flatten(Curve)
length = Length(Curve=project)
length_2 = Length(Curve=project_2)
merge_6 = Merge(Data1=ggnetworkpolygons, Data2=mirror_3.Geometry)
length_3 = Length(Curve=project_3)
list_length_2 = ListLength(List=length_3)
series = Series(Start=1, Step=1, Count=expr("X-1", list_length_2))
relative_differences = RelativeDifferences(Values=length_3)
panel_6 = Panel(length)
panel_7 = Panel(length_2)
division_6 = Division(A=length_2, B=length)
panel_8 = Panel(division_6)
polar_array = PolarArray(
    Geometry=graft(merge_6),
    Plane=[Plane(origin=(0, 0, 0), x=(0, 0, 1), y=(1, 0, 0)), PlaneYZ(0, 0, 0)],
    Count=2,
    Angle=3.141592654)  # -> Geometry, Transform
discontinuity = Discontinuity(Curve=ggnetworkpolygons, Level=1)  # -> Points, Parameters
list_item_7 = ListItem(List=relative_differences, Index=series, Wrap=False)

quick_graph_5 = QuickGraph(length_3, SortOrder=0)
quick_graph_6 = QuickGraph(list_item_7, SortOrder=0)

quick_graph_7 = QuickGraph(length_3, SortOrder=0)
geometry = Geometry(polar_array.Geometry)
list_item_8 = ListItem(List=discontinuity.Points, Index=0, Wrap=False)  # -> Item, Item1, Item2, Item3, Item4
_4point_surface = _4PointSurface(CornerA=list_item_8.Item, CornerB=list_item_8.Item1, CornerC=list_item_8.Item2, CornerD=list_item_8.Item3)  # disabled
panel_10 = Panel(list_item_8.Item)
brep_join = BrepJoin(Breps=flatten(_4point_surface))  # -> Breps, Closed; disabled
merge_7 = Merge(Data1=list_item_8.Item, Data2=list_item_8.Item1, Data3=list_item_8.Item2, Data4=list_item_8.Item3)
brep_plane = BrepPlane(Brep=brep_join.Breps, Plane=plane_surface_3)  # -> Curves, Points; disabled
construct_mesh = ConstructMesh(Vertices=merge_7, Faces={A=0, B=1, C=2, D=3})  # -> flatten(Mesh)
mesh_join = MeshJoin(Meshes=flatten(construct_mesh))
mirror_cut_mesh = MirrorCutMesh(
    Mesh=mesh_join,
    MirrorPlane=plane_surface_3,
    Reach=0,
    Offset=0,
    Flip=False,
    Join=True,
    Keep=False,
    ConnectionType=1,
    Bulge=0,
    Divisions=1,
    WeldVertices=0.0009765625)  # -> MirrorCut, SplitIndex, ReachPlane, OffsetPlane, Intersected
mirror_4 = Mirror(Geometry=mirror_cut_mesh.MirrorCut, Plane=PlaneXY(0, 0, 0))  # -> Geometry, Transform
merge_8 = Merge(Data1=mirror_cut_mesh.MirrorCut, Data2=mirror_4.Geometry)
polar_array_2 = PolarArray(
    Geometry=graft(merge_8),
    Plane=[Plane(origin=(0, 0, 0), x=(0, 0, 1), y=(1, 0, 0)), PlaneYZ(0, 0, 0)],
    Count=2,
    Angle=3.141592654)  # -> Geometry, Transform
mesh_join_2 = MeshJoin(Meshes=flatten(mirror_cut_mesh.MirrorCut))  # disabled
mirror_cut_mesh_2 = MirrorCutMesh(
    Mesh=mirror_cut_mesh.MirrorCut,
    MirrorPlane=Plane(origin=(0, 0, 0), x=(0, 0, 1), y=(1, 0, 0)),
    Reach=0,
    Offset=0,
    Flip=False,
    Join=True,
    Keep=False,
    ConnectionType=1,
    Bulge=0,
    Divisions=1,
    WeldVertices=0.0009765625)  # -> MirrorCut, SplitIndex, ReachPlane, OffsetPlane, Intersected; disabled
geometry_2 = Geometry(polar_array_2.Geometry)
