# Grasshopper definition XHG.⠀⠀⠀⠀◯⠀ᔓᔕᕤᕦИNꖴ✤ᗱᗴᔓᔕ⠀◯⠀ᙁᗩᑎᔓᔕꖴᗯ⠀◯⠀ᙁᗩИNⓄꖴ✤ꖴᗝᗩ◯⠀ᗱᗴᑐᑕᗩꗳᴥᗱᗴ✤ИNꖴ⠀◯⠀ᴥᗱᗴߦⓄ옷ᔓᔕᗩᴥᕤᕦ⠀◯⠀⠀⠀⠀ⵙ⠀⠀⠀⠀◯⠀ᕤᕦᴥᗩᔓᔕ옷Ⓞߦᗱᗴᴥ⠀◯⠀ꖴИN✤ᗱᗴᴥꗳᗩᑐᑕᗱᗴ⠀◯⠀ᗩᗝꖴ✤ꖴⓄИNᗩᙁ⠀◯⠀ᗯꖴᔓᔕᑎᗩᙁ⠀◯⠀ᔓᔕᗱᗴ✤ꖴИNᕤᕦᔓᔕ⠀◯⠀⠀⠀⠀.GHX (Grasshopper 1.0.7)

ᴥ_ᙁ_ᑐᑕ_ᗝиnᑎ_ᴥᕤᕦ_ᑐᑕᗩ8_ᔓᔕᗩᗯиnᗩᑐᑕ_ᑐᑕᗩиnᗯᗩᔓᔕ = ColourSwatch(SwatchColor=RGB(255, 255, 255))  # "◯ᴥⓄᙁⓄᑐᑕ◯ᗝИNᑎⓄᴥᕤᕦ✻ᑐᑕᗩ8◯ᔓᔕᗩᗯИNᗩᑐᑕ◯⦿◯ᑐᑕᗩИNᗯᗩᔓᔕ◯8ᗩᑐᑕ✻ᕤᕦᴥⓄᑎИNᗝ◯ᑐᑕⓄᙁⓄᴥ◯"
ᴥ_ᙁ_ᑐᑕ_ᗱᗴᕤᕦᗝᗱᗴ_ᔓᔕᗩᗯиnᗩᑐᑕ_ᑐᑕᗩиnᗯᗩᔓᔕ_ᗱᗴᗝᕤᕦ = ColourSwatch(SwatchColor=RGB(217, 217, 217))  # "◯ᴥⓄᙁⓄᑐᑕ◯ᗱᗴᕤᕦᗝᗱᗴ◯ᔓᔕᗩᗯИNᗩᑐᑕ◯⦿◯ᑐᑕᗩИNᗯᗩᔓᔕ◯ᗱᗴᗝᕤᕦᗱᗴ◯ᑐᑕⓄᙁⓄᴥ◯"
ᴥ_ᙁ_ᑐᑕ_ᗝ_ᴥᕤᕦ_ᔓᔕᗩᗯиnᗩᑐᑕ_ᑐᑕᗩиnᗯᗩᔓᔕ_ᕤᕦᴥ_ᗝ_ᑐ = ColourSwatch(SwatchColor=RGB(247, 247, 247))  # "◯ᴥⓄᙁⓄᑐᑕ◯ᗝ⊙ᴥᕤᕦ◯ᔓᔕᗩᗯИNᗩᑐᑕ◯⦿◯ᑐᑕᗩИNᗯᗩᔓᔕ◯ᕤᕦᴥ⊙ᗝ◯ᑐᑕⓄᙁⓄᴥ◯"
ᙁᗩᗯᴥᗱᗴ_иn_ᔓᔕиnᙏᑎᙁ_ᑐᑕ_ᗝ_ᴥᕤᕦ_ᔓᔕᗩᗯиnᗩᑐᑕ_ᑐᑕᗩ = Slider(2, range=0..1024)  # "◯ᙁᗩᗯᴥᗱᗴ✤ИN⊙◯ᔓᔕИNᙏᑎᙁⓄᑐᑕ◯ᗝ⊙ᴥᕤᕦ◯ᔓᔕᗩᗯИNᗩᑐᑕ◯⦿◯ᑐᑕᗩИNᗯᗩᔓᔕ◯ᕤᕦᴥ⊙ᗝ◯ᑐᑕⓄᙁᑎᙏИNᔓᔕ◯⊙ИN✤ᗱᗴᴥᗯᗩᙁ◯"
ᙁᗩᗯᴥᗱᗴ_иn_ᔓᔕᗯ_ᴥ_ᗝ_ᴥᕤᕦ_ᔓᔕᗩᗯиnᗩᑐᑕ_ᑐᑕᗩиnᗯᗩᔓ = Slider(2, range=0..1024)  # "◯ᙁᗩᗯᴥᗱᗴ✤ИN⊙◯ᔓᔕᗯⓄᴥ◯ᗝ⊙ᴥᕤᕦ◯ᔓᔕᗩᗯИNᗩᑐᑕ◯⦿◯ᑐᑕᗩИNᗯᗩᔓᔕ◯ᕤᕦᴥ⊙ᗝ◯ᴥⓄᗯᔓᔕ◯⊙ИN✤ᗱᗴᴥᗯᗩᙁ◯"
옷ᑐᑕ_ᗯᔓᔕ_ᴥ_ᙁ_ᑐᑕ_ᗝ_ᙁ_ᔓᔕ_ᗝиnᑎ_ᴥᕤᕦ_ᑐᑕᗩ8_ᔓᔕᗩᗯ = BooleanToggle(False)  # "◯옷ᑐᑕ✤⊙ᗯᔓᔕ◯ᴥⓄᙁⓄᑐᑕ◯ᗝ⊙ᙁⓄᔓᔕ◯ᗝИNᑎⓄᴥᕤᕦ✻ᑐᑕᗩ8◯ᔓᔕᗩᗯИNᗩᑐᑕ◯⦿◯ᑐᑕᗩИNᗯᗩᔓᔕ◯8ᗩᑐᑕ✻ᕤᕦᴥⓄᑎИNᗝ◯ᔓᔕⓄᙁ⊙ᗝ◯ᑐᑕⓄᙁⓄᴥ◯ᔓᔕᗯ⊙✤ᑐᑕ옷◯"
ᴥ_ᙁ_ᑐᑕ_ᗝ_ᙁ_ᔓᔕ_ᗝиnᑎ_ᴥᕤᕦ_ᑐᑕᗩ8_ᔓᔕᗩᗯиnᗩᑐᑕ_ᑐᑕ = ColourSwatch(SwatchColor=RGB(255, 255, 255))  # "◯ᴥⓄᙁⓄᑐᑕ◯ᗝ⊙ᙁⓄᔓᔕ◯ᗝИNᑎⓄᴥᕤᕦ✻ᑐᑕᗩ8◯ᔓᔕᗩᗯИNᗩᑐᑕ◯⦿◯ᑐᑕᗩИNᗯᗩᔓᔕ◯8ᗩᑐᑕ✻ᕤᕦᴥⓄᑎИNᗝ◯ᔓᔕⓄᙁ⊙ᗝ◯ᑐᑕⓄᙁⓄᴥ◯"
ᴥ_ᙁ_ᑐᑕ_ᗯ_ᗝᗩ옷ᔓᔕ_ᔓᔕᗩᗯиnᗩᑐᑕ_ᑐᑕᗩиnᗯᗩᔓᔕ_ᔓᔕ옷ᗩᗝ = ColourSwatch(SwatchColor=RGB(255, 255, 255))  # "◯ᴥⓄᙁⓄᑐᑕ◯ᗯⓄᗝᗩ옷ᔓᔕ◯ᔓᔕᗩᗯИNᗩᑐᑕ◯⦿◯ᑐᑕᗩИNᗯᗩᔓᔕ◯ᔓᔕ옷ᗩᗝⓄᗯ◯ᑐᑕⓄᙁⓄᴥ◯"
ᗱᗴᔓᔕ_ᔓᔕ_ᗯ_ᗝᗩ옷ᔓᔕ_ᔓᔕᗩᗯиnᗩᑐᑕ_ᑐᑕᗩиnᗯᗩᔓᔕ_ᔓᔕ옷ᗩ = Slider(4, range=0..1024)  # "◯ᗱᗴᔓᔕ⊙ᔓᔕ◯ᗯⓄᗝᗩ옷ᔓᔕ◯ᔓᔕᗩᗯИNᗩᑐᑕ◯⦿◯ᑐᑕᗩИNᗯᗩᔓᔕ◯ᔓᔕ옷ᗩᗝⓄᗯ◯ᔓᔕ⊙ᔓᔕᗱᗴ◯"
ᴥ_ᙁ_ᑐᑕ_ᙁ_θ_ᙁᑎᗩθᗱᗴᗝ_ᔓᔕ_ᑐᑕᗱᗴᒍᒐ8_ᑫᑭᑎ_ᴥᕤᕦ_ᕤᕦ = ColourSwatch(SwatchColor=RGB(255, 255, 255))  # "◯ᴥⓄᙁⓄᑐᑕ◯ᙁ⊙Θ◯✤ᙁᑎᗩΘᗱᗴᗝ◯ᔓᔕ✤ᑐᑕᗱᗴᒍᒐ8Ⓞ◯ᑫᑭᑎⓄᴥᕤᕦ◯⦿◯ᕤᕦᴥⓄᑎᑫᑭ◯Ⓞ8ᒍᒐᗱᗴᑐᑕ✤ᔓᔕ◯ᗝᗱᗴΘᗩᑎᙁ✤◯Θ⊙ᙁ◯ᑐᑕⓄᙁⓄᴥ◯"
ᴥ_ᙁ_ᑐᑕ_ᙁ_θ_ᙁᑎᗩθᗱᗴᗝ_ᔓᔕ_ᑐᑕᗱᗴᒍᒐ8_ᙁᗱᗴиnᗩᑫᑭ_ᑫ = ColourSwatch(SwatchColor=RGB(255, 255, 255))  # "◯ᴥⓄᙁⓄᑐᑕ◯ᙁ⊙Θ◯✤ᙁᑎᗩΘᗱᗴᗝ◯ᔓᔕ✤ᑐᑕᗱᗴᒍᒐ8Ⓞ◯ᙁᗱᗴИNᗩᑫᑭ◯⦿◯ᑫᑭᗩИNᗱᗴᙁ◯Ⓞ8ᒍᒐᗱᗴᑐᑕ✤ᔓᔕ◯ᗝᗱᗴΘᗩᑎᙁ✤◯Θ⊙ᙁ◯ᑐᑕⓄᙁⓄᴥ◯"
ᴥ_ᙁ_ᑐᑕ_ᗱᗴᴥ_ᗯ_ᙁᑎᗩθᗱᗴᗝ_ᗝᗱᗴθᗩᑎᙁ_ᗯ_ᴥᗱᗴ_ᑐᑕ_ᙁ = ColourSwatch(SwatchColor=RGB(217, 217, 217))  # "◯ᴥⓄᙁⓄᑐᑕ◯ᗱᗴᴥ⊙ᗯ◯✤ᙁᑎᗩΘᗱᗴᗝ◯⦿◯ᗝᗱᗴΘᗩᑎᙁ✤◯ᗯ⊙ᴥᗱᗴ◯ᑐᑕⓄᙁⓄᴥ◯"
ᴥ_ᙁ_ᑐᑕ_ᔓᔕᗱᗴᴥ_ᗯ_ᙁᑎиn_人_ᑫᑭᙏᗱᗴ_ᗱᗴᙏᑫᑭ_人_иnᑎᙁ = ColourSwatch(SwatchColor=RGB(212, 212, 212))  # "◯ᴥⓄᙁⓄᑐᑕ◯ᔓᔕᗱᗴᴥ⊙ᗯ◯ᙁᑎИN◯人✤ᑫᑭᙏᗱᗴ◯⦿◯ᗱᗴᙏᑫᑭ✤人◯ИNᑎᙁ◯ᗯ⊙ᴥᗱᗴᔓᔕ◯ᑐᑕⓄᙁⓄᴥ◯"
ᴥ_ᙁ_ᑐᑕ_ᔓᔕᗱᗴᴥ_ᗯ_ᗝиnᗱᗴ_ᗝᗱᗴ_ᑐᑕᗱᗴᙁᗱᗴᔓᔕ_ᔓᔕᗱᗴᙁ = ColourSwatch(SwatchColor=RGB(201, 201, 201))  # "◯ᴥⓄᙁⓄᑐᑕ◯ᔓᔕᗱᗴᴥ⊙ᗯ◯ᗝИNᗱᗴ◯ᗝᗱᗴ✤ᑐᑕᗱᗴᙁᗱᗴᔓᔕ⦿◯ᔓᔕᗱᗴᙁᗱᗴᑐᑕ✤ᗱᗴᗝ◯ᗱᗴИNᗝ◯ᗯ⊙ᴥᗱᗴᔓᔕ◯ᑐᑕⓄᙁⓄᴥ◯"
ᴥ_ᙁ_ᑐᑕ_ᔓᔕᗱᗴᴥ_ᗯ_ᗝиnᗱᗴ_ᗝᗱᗴ_ᑐᑕᗱᗴᙁᗱᗴᔓᔕиnᑎ_ᑎи = ColourSwatch(SwatchColor=RGB(217, 217, 217))  # "◯ᴥⓄᙁⓄᑐᑕ◯ᔓᔕᗱᗴᴥ⊙ᗯ◯ᗝИNᗱᗴ◯ᗝᗱᗴ✤ᑐᑕᗱᗴᙁᗱᗴᔓᔕИNᑎ◯⦿◯ᑎИNᔓᔕᗱᗴᙁᗱᗴᑐᑕ✤ᗱᗴᗝ◯ᗱᗴИNᗝ◯ᗯ⊙ᴥᗱᗴᔓᔕ◯ᑐᑕⓄᙁⓄᴥ◯"
ᴥ_ᙁ_ᑐᑕ_ᗱᗴᕤᕦᗝᗱᗴ_ᙁᑎᗩθᗱᗴᗝ_ᔓᔕ_иnᗱᗴᙏᗱᗴᙁᗱᗴ_ᑎᔓᔕ = ColourSwatch(SwatchColor=RGB(217, 217, 217))  # "◯ᴥⓄᙁⓄᑐᑕ◯ᗱᗴᕤᕦᗝᗱᗴ◯✤ᙁᑎᗩΘᗱᗴᗝ◯ᔓᔕ✤ИNᗱᗴᙏᗱᗴᙁᗱᗴ◯⊙ᑎᔓᔕ◯⦿◯ᔓᔕᑎ⊙◯ᗱᗴᙁᗱᗴᙏᗱᗴИN✤ᔓᔕ◯ᗝᗱᗴΘᗩᑎᙁ✤◯ᗱᗴᗝᕤᕦᗱᗴ◯ᑐᑕⓄᙁⓄᴥ◯"
ᴥ_ᙁ_ᑐᑕ_ᗱᗴᕤᕦᗝᗱᗴ_ᙁᑎᗩθᗱᗴᗝ_ᔓᔕ_иnᗱᗴᙏᗱᗴᙁᗱᗴ_ᑎᔓᔕ_2 = ColourSwatch(SwatchColor=RGB(201, 201, 201))  # "◯ᴥⓄᙁⓄᑐᑕ◯ᗱᗴᕤᕦᗝᗱᗴ◯✤ᙁᑎᗩΘᗱᗴᗝ◯ᔓᔕ✤ИNᗱᗴᙏᗱᗴᙁᗱᗴ◯⊙ᑎᔓᔕ◯ᗝᗱᗴ✤옷ᕤᕦ⊙ᙁ옷ᕤᕦ⊙옷◯⦿◯옷⊙ᕤᕦ옷ᙁ⊙ᕤᕦ옷✤ᗱᗴᗝ◯ᔓᔕᑎ⊙◯ᗱᗴᙁᗱᗴᙏᗱᗴИN✤ᔓᔕ◯ᗝᗱᗴΘᗩᑎᙁ✤◯ᗱᗴᗝᕤᕦᗱᗴ◯ᑐᑕⓄᙁⓄᴥ◯"
ᴥ_ᙁ_ᑐᑕ_ᙁ_θ_ᙁᑎᗩθᗱᗴᗝ_ᔓᔕ_иnᗱᗴᙏᗱᗴᙁᗱᗴ_ᑎᔓᔕ_ᔓᔕᑎ = ColourSwatch(SwatchColor=RGB(255, 255, 255))  # "◯ᴥⓄᙁⓄᑐᑕ◯ᙁ⊙Θ◯✤ᙁᑎᗩΘᗱᗴᗝ◯ᔓᔕ✤ИNᗱᗴᙏᗱᗴᙁᗱᗴ◯⊙ᑎᔓᔕ◯⦿◯ᔓᔕᑎ⊙◯ᗱᗴᙁᗱᗴᙏᗱᗴИN✤ᔓᔕ◯ᗝᗱᗴΘᗩᑎᙁ✤◯Θ⊙ᙁ◯ᑐᑕⓄᙁⓄᴥ◯"
ᴥ_ᙁ_ᑐᑕ_ᙁ_θ_ᙁᑎᗩθᗱᗴᗝ_ᔓᔕ_иnᗱᗴᙏᗱᗴᙁᗱᗴ_ᑎᔓᔕ_ᗝᗱᗴ = ColourSwatch(SwatchColor=RGB(212, 212, 212))  # "◯ᴥⓄᙁⓄᑐᑕ◯ᙁ⊙Θ◯✤ᙁᑎᗩΘᗱᗴᗝ◯ᔓᔕ✤ИNᗱᗴᙏᗱᗴᙁᗱᗴ◯⊙ᑎᔓᔕ◯ᗝᗱᗴ✤옷ᕤᕦ⊙ᙁ옷ᕤᕦ⊙옷◯⦿◯옷⊙ᕤᕦ옷ᙁ⊙ᕤᕦ옷✤ᗱᗴᗝ◯ᔓᔕᑎ⊙◯ᗱᗴᙁᗱᗴᙏᗱᗴИN✤ᔓᔕ◯ᗝᗱᗴΘᗩᑎᙁ✤◯Θ⊙ᙁ◯ᑐᑕⓄᙁⓄᴥ◯"
c_script = CSharpScript(
    O____KCAB_SAVNAC____O____CANVAS_BACK____O=ᴥ_ᙁ_ᑐᑕ_ᗝиnᑎ_ᴥᕤᕦ_ᑐᑕᗩ8_ᔓᔕᗩᗯиnᗩᑐᑕ_ᑐᑕᗩиnᗯᗩᔓᔕ,
    O____EGDE_SAVNAC____O____CANVAS_EDGE____O=ᴥ_ᙁ_ᑐᑕ_ᗱᗴᕤᕦᗝᗱᗴ_ᔓᔕᗩᗯиnᗩᑐᑕ_ᑐᑕᗩиnᗯᗩᔓᔕ_ᗱᗴᗝᕤᕦ,
    O____DIRG_SAVNAC____O____CANVAS_GRID____O=ᴥ_ᙁ_ᑐᑕ_ᗝ_ᴥᕤᕦ_ᔓᔕᗩᗯиnᗩᑐᑕ_ᑐᑕᗩиnᗯᗩᔓᔕ_ᕤᕦᴥ_ᗝ_ᑐ,
    O____LOC_DIRG_SAVNAC____O____CANVAS_GRID_COL____O=ᙁᗩᗯᴥᗱᗴ_иn_ᔓᔕиnᙏᑎᙁ_ᑐᑕ_ᗝ_ᴥᕤᕦ_ᔓᔕᗩᗯиnᗩᑐᑕ_ᑐᑕᗩ,
    O____WOR_DIRG_SAVNAC____O____CANVAS_GRID_ROW____O=ᙁᗩᗯᴥᗱᗴ_иn_ᔓᔕᗯ_ᴥ_ᗝ_ᴥᕤᕦ_ᔓᔕᗩᗯиnᗩᑐᑕ_ᑐᑕᗩиnᗯᗩᔓ,
    O____ONOM_SAVNAC____O____CANVAS_MONO____O=옷ᑐᑕ_ᗯᔓᔕ_ᴥ_ᙁ_ᑐᑕ_ᗝ_ᙁ_ᔓᔕ_ᗝиnᑎ_ᴥᕤᕦ_ᑐᑕᗩ8_ᔓᔕᗩᗯ,
    O____ROLOC_ONOM_SAVNAC____O____CANVAS_MONO_COLOR____O=ᴥ_ᙁ_ᑐᑕ_ᗝ_ᙁ_ᔓᔕ_ᗝиnᑎ_ᴥᕤᕦ_ᑐᑕᗩ8_ᔓᔕᗩᗯиnᗩᑐᑕ_ᑐᑕ,
    O____EDAHS_SAVNAC____O____CANVAS_SHADE____O=ᴥ_ᙁ_ᑐᑕ_ᗯ_ᗝᗩ옷ᔓᔕ_ᔓᔕᗩᗯиnᗩᑐᑕ_ᑐᑕᗩиnᗯᗩᔓᔕ_ᔓᔕ옷ᗩᗝ,
    O____EZIS_EDAHS_SAVNAC____O____CANVAS_SHADE_SIZE____O=ᗱᗴᔓᔕ_ᔓᔕ_ᗯ_ᗝᗩ옷ᔓᔕ_ᔓᔕᗩᗯиnᗩᑐᑕ_ᑐᑕᗩиnᗯᗩᔓᔕ_ᔓᔕ옷ᗩ,
    O____KCAB_PUORG____O____GROUP_BACK____O=ᴥ_ᙁ_ᑐᑕ_ᙁ_θ_ᙁᑎᗩθᗱᗴᗝ_ᔓᔕ_ᑐᑕᗱᗴᒍᒐ8_ᑫᑭᑎ_ᴥᕤᕦ_ᕤᕦ,
    O____KCAB_LENAP____O____PANEL_BACK____O=ᴥ_ᙁ_ᑐᑕ_ᙁ_θ_ᙁᑎᗩθᗱᗴᗝ_ᔓᔕ_ᑐᑕᗱᗴᒍᒐ8_ᙁᗱᗴиnᗩᑫᑭ_ᑫ,
    O____TLUAFED_ERIW____O____WIRE_DEFAULT____O=ᴥ_ᙁ_ᑐᑕ_ᗱᗴᴥ_ᗯ_ᙁᑎᗩθᗱᗴᗝ_ᗝᗱᗴθᗩᑎᙁ_ᗯ_ᴥᗱᗴ_ᑐᑕ_ᙁ,
    O____YTPME_ERIW____O____WIRE_EMPTY____O=ᴥ_ᙁ_ᑐᑕ_ᔓᔕᗱᗴᴥ_ᗯ_ᙁᑎиn_人_ᑫᑭᙏᗱᗴ_ᗱᗴᙏᑫᑭ_人_иnᑎᙁ,
    O____A_DETCELES_ERIW____O____WIRE_SELECTED_A____O=ᴥ_ᙁ_ᑐᑕ_ᔓᔕᗱᗴᴥ_ᗯ_ᗝиnᗱᗴ_ᗝᗱᗴ_ᑐᑕᗱᗴᙁᗱᗴᔓᔕ_ᔓᔕᗱᗴᙁ,
    O____B_DETCELES_ERIW____O____WIRE_SELECTED_B____O=ᴥ_ᙁ_ᑐᑕ_ᔓᔕᗱᗴᴥ_ᗯ_ᗝиnᗱᗴ_ᗝᗱᗴ_ᑐᑕᗱᗴᙁᗱᗴᔓᔕиnᑎ_ᑎи,
    O____EGDE_IUZ____O____ZUI_EDGE____O=ᴥ_ᙁ_ᑐᑕ_ᗱᗴᕤᕦᗝᗱᗴ_ᙁᑎᗩθᗱᗴᗝ_ᔓᔕ_иnᗱᗴᙏᗱᗴᙁᗱᗴ_ᑎᔓᔕ,
    O____THGILHGIH_EGDE_IUZ____O____ZUI_EDGE_HIGHLIGHT____O=ᴥ_ᙁ_ᑐᑕ_ᗱᗴᕤᕦᗝᗱᗴ_ᙁᑎᗩθᗱᗴᗝ_ᔓᔕ_иnᗱᗴᙏᗱᗴᙁᗱᗴ_ᑎᔓᔕ_2,
    O____LIF_IUZ____O____ZUI_FIL____O=ᴥ_ᙁ_ᑐᑕ_ᙁ_θ_ᙁᑎᗩθᗱᗴᗝ_ᔓᔕ_иnᗱᗴᙏᗱᗴᙁᗱᗴ_ᑎᔓᔕ_ᔓᔕᑎ,
    O____THGILHGIH_LIF_IUZ____O____ZUI_FIL_HIGHLIGHT____O=ᴥ_ᙁ_ᑐᑕ_ᙁ_θ_ᙁᑎᗩθᗱᗴᗝ_ᔓᔕ_иnᗱᗴᙏᗱᗴᙁᗱᗴ_ᑎᔓᔕ_ᗝᗱᗴ)  # -> O; inputs O____KCAB_SAVNAC____O____CANVAS_BACK____O: Color, O____EGDE_SAVNAC____O____CANVAS_EDGE____O: Color, O____DIRG_SAVNAC____O____CANVAS_GRID____O: Color, O____LOC_DIRG_SAVNAC____O____CANVAS_GRID_COL____O: Int32, O____WOR_DIRG_SAVNAC____O____CANVAS_GRID_ROW____O: Int32, O____ONOM_SAVNAC____O____CANVAS_MONO____O: Boolean, O____ROLOC_ONOM_SAVNAC____O____CANVAS_MONO_COLOR____O: Color, O____EDAHS_SAVNAC____O____CANVAS_SHADE____O: Color, O____EZIS_EDAHS_SAVNAC____O____CANVAS_SHADE_SIZE____O: Int32, O____KCAB_PUORG____O____GROUP_BACK____O: Color, O____KCAB_LENAP____O____PANEL_BACK____O: Color, O____TLUAFED_ERIW____O____WIRE_DEFAULT____O: Color, O____YTPME_ERIW____O____WIRE_EMPTY____O: Color, O____A_DETCELES_ERIW____O____WIRE_SELECTED_A____O: Color, O____B_DETCELES_ERIW____O____WIRE_SELECTED_B____O: Color, O____EGDE_IUZ____O____ZUI_EDGE____O: Color, O____THGILHGIH_EGDE_IUZ____O____ZUI_EDGE_HIGHLIGHT____O: Color, O____LIF_IUZ____O____ZUI_FIL____O: Color, O____THGILHGIH_LIF_IUZ____O____ZUI_FIL_HIGHLIGHT____O: Color
# ---------- c_script: C# usings ----------
using System.IO;
using System.Linq;
using System.Data;
using System.Drawing;
using System.Reflection;
using System.Windows.Forms;
using System.Xml;
using System.Xml.Linq;
using System.Runtime.InteropServices;

using Rhino.DocObjects;
using Rhino.Collections;
using GH_IO;
using GH_IO.Serialization;
# ---------- c_script: C# ----------
    Grasshopper.GUI.Canvas.GH_Skin.canvas_back = O____KCAB_SAVNAC____O____CANVAS_BACK____O;
    Grasshopper.GUI.Canvas.GH_Skin.canvas_edge = O____EGDE_SAVNAC____O____CANVAS_EDGE____O;
    Grasshopper.GUI.Canvas.GH_Skin.canvas_grid = O____DIRG_SAVNAC____O____CANVAS_GRID____O;
    Grasshopper.GUI.Canvas.GH_Skin.canvas_grid_col = O____LOC_DIRG_SAVNAC____O____CANVAS_GRID_COL____O;
    Grasshopper.GUI.Canvas.GH_Skin.canvas_grid_row = O____WOR_DIRG_SAVNAC____O____CANVAS_GRID_ROW____O;
    Grasshopper.GUI.Canvas.GH_Skin.canvas_mono = O____ONOM_SAVNAC____O____CANVAS_MONO____O;
    Grasshopper.GUI.Canvas.GH_Skin.canvas_mono_color = O____ROLOC_ONOM_SAVNAC____O____CANVAS_MONO_COLOR____O;
    Grasshopper.GUI.Canvas.GH_Skin.canvas_shade = O____EDAHS_SAVNAC____O____CANVAS_SHADE____O;
    Grasshopper.GUI.Canvas.GH_Skin.canvas_shade_size = O____EZIS_EDAHS_SAVNAC____O____CANVAS_SHADE_SIZE____O;
    Grasshopper.GUI.Canvas.GH_Skin.group_back = O____KCAB_PUORG____O____GROUP_BACK____O;
    Grasshopper.GUI.Canvas.GH_Skin.panel_back = O____KCAB_LENAP____O____PANEL_BACK____O;
    Grasshopper.GUI.Canvas.GH_Skin.wire_default = O____TLUAFED_ERIW____O____WIRE_DEFAULT____O;
    Grasshopper.GUI.Canvas.GH_Skin.wire_empty = O____YTPME_ERIW____O____WIRE_EMPTY____O;
    Grasshopper.GUI.Canvas.GH_Skin.wire_selected_a = O____A_DETCELES_ERIW____O____WIRE_SELECTED_A____O;
    Grasshopper.GUI.Canvas.GH_Skin.wire_selected_b = O____B_DETCELES_ERIW____O____WIRE_SELECTED_B____O;
    Grasshopper.GUI.Canvas.GH_Skin.zui_edge = O____EGDE_IUZ____O____ZUI_EDGE____O;
    Grasshopper.GUI.Canvas.GH_Skin.zui_edge_highlight = O____THGILHGIH_EGDE_IUZ____O____ZUI_EDGE_HIGHLIGHT____O;
    Grasshopper.GUI.Canvas.GH_Skin.zui_fill = O____LIF_IUZ____O____ZUI_FIL____O;
    Grasshopper.GUI.Canvas.GH_Skin.zui_fill_highlight = O____THGILHGIH_LIF_IUZ____O____ZUI_FIL_HIGHLIGHT____O;
# ---------- end c_script ----------
