# Dynamo graph ИYD.◯ⵘ◯ᔓᔕᑎИNᗱᗴᕤᕦ◯⚪◯ᕤᕦᗱᗴИNᑎᔓᔕ◯ⵘ◯⦿◯ⵘ◯ᔓᔕᑎИNᗱᗴᕤᕦ◯⚪◯ᕤᕦᗱᗴИNᑎᔓᔕ◯ⵘ◯ⵙ◯ⵘ◯ᔓᔕᑎИNᗱᗴᕤᕦ◯⚪◯ᕤᕦᗱᗴИNᑎᔓᔕ◯ⵘ◯⦿◯ⵘ◯ᔓᔕᑎИNᗱᗴᕤᕦ◯⚪◯ᕤᕦᗱᗴИNᑎᔓᔕ◯ⵘ◯.DYN (Dynamo 1.0.0.1126)

code_block = CodeBlock { 0; }
code_block_2 = CodeBlock { 0.5; }
code_block_3 = CodeBlock { -90; }
code_block_4 = CodeBlock { 0; }
number_slider = DoubleSlider(0, range=0..100 step 0.1)
O_EZIS_O_SIZE_O = DoubleSlider(1, range=0..16 step 0.1)
code_block_5 = CodeBlock { 2; }
div = O_EZIS_O_SIZE_O / code_block_5
sqrt = Math.Sqrt(div)
mul = sqrt * code_block_5
number_slider_2 = DoubleSlider(0, range=0..100 step 0.1)
byCoordinates = Point.ByCoordinates(x=number_slider, y=mul, z=number_slider_2)
O_SENKCIHT_O_THICKNES_O = DoubleSlider(0.5, range=0..4 step 0.1)
code_block_6 = CodeBlock { -180; }
code_block_7 = CodeBlock { 0; }
code_block_8 = CodeBlock { 1; }
byCoordinates_2 = Vector.ByCoordinates(x=code_block_8)
byCenterPointRadiusAngle = Arc.ByCenterPointRadiusAngle(center=byCoordinates, radius=O_SENKCIHT_O_THICKNES_O, startAngle=code_block_6, endAngle=code_block_7, normal=byCoordinates_2)
YZ = Plane.YZ()
code_block_9 = CodeBlock { 45; }
rotate = Geometry.Rotate(byCenterPointRadiusAngle, YZ, code_block_9)
YAxis = Vector.YAxis()
code_block_10 = CodeBlock { 90; }
byRevolve = Surface.ByRevolve(rotate, arg2=YAxis, arg4=code_block_10)
code_block_11 = CodeBlock { 90; }
rotate_2 = Geometry.Rotate(byRevolve, YZ, code_block_11)
XY = Plane.XY()
rotate_3 = Geometry.Rotate(rotate_2, XY, code_block_11)
rotate_4 = Geometry.Rotate(rotate_3, YZ, code_block_11)
rotate_5 = Geometry.Rotate(rotate_4, XY, code_block_11)
code_block_12 = CodeBlock { 1; }
code_block_13 = CodeBlock { 0; }
getIsoline = Surface.GetIsoline(rotate_5, code_block_12, code_block_13)
code_block_14 = CodeBlock { 0.75; }
code_block_15 = CodeBlock { 0.5; }
trimByParameter = Curve.TrimByParameter(getIsoline, code_block_14, code_block_15)
rotate_6 = Geometry.Rotate(trimByParameter, YZ, code_block_11)
rotate_7 = Geometry.Rotate(rotate_6, XY, code_block_11)
rotate_8 = Geometry.Rotate(rotate_7, YZ, code_block_11)
rotate_9 = Geometry.Rotate(rotate_8, XY, code_block_11)
join = Curve.Join(curve=rotate_7, curves=rotate_9)
join_2 = Curve.Join(curve=join, curves=trimByParameter)
patch = Curve.Patch(join_2)
code_block_16 = CodeBlock { 1; }
code_block_17 = CodeBlock { 1; }
getIsoline_2 = Surface.GetIsoline(rotate_5, code_block_16, code_block_17)
code_block_18 = CodeBlock { 0.75; }
code_block_19 = CodeBlock { 0.5; }
trimByParameter_2 = Curve.TrimByParameter(getIsoline_2, code_block_18, code_block_19)
rotate_10 = Geometry.Rotate(trimByParameter_2, YZ, code_block_11)
rotate_11 = Geometry.Rotate(rotate_10, XY, code_block_11)
rotate_12 = Geometry.Rotate(rotate_11, YZ, code_block_11)
rotate_13 = Geometry.Rotate(rotate_12, XY, code_block_11)
join_3 = Curve.Join(curve=rotate_11, curves=rotate_13)
join_4 = Curve.Join(curve=join_3, curves=trimByParameter_2)
patch_2 = Curve.Patch(join_4)
create = List.Create(patch, patch_2, byRevolve, rotate_3, rotate_5)
byJoinedSurfaces = PolySurface.ByJoinedSurfaces(create)
XZ = Plane.XZ()
mirror = Geometry.Mirror(geometry=byJoinedSurfaces, mirrorPlane=XZ)
create_2 = List.Create(byJoinedSurfaces, mirror)
YZ_2 = Plane.YZ()
mirror_2 = Geometry.Mirror(geometry=create_2, mirrorPlane=YZ_2)
create_3 = List.Create(create_2, mirror_2)
XY_2 = Plane.XY()
mirror_3 = Geometry.Mirror(geometry=create_3, mirrorPlane=XY_2)
create_4 = List.Create(create_3, mirror_3)
byJoinedSurfaces_2 = PolySurface.ByJoinedSurfaces(create_4)
