# Grasshopper definition XHG.⠀ⵙИNⵙⓄⵙꖴⵙ✤ⵙᑐᑕⵙᑎⵙᗝⵙⓄⵙᴥⵙߦⵙ⠀◯⠀ⵙᗩⵙᗝⵙᙁⵙᗱᗴⵙᙏⵙ⠀◯⠀ⵙᴥⵙⓄⵙꗳⵙ⠀◯⠀ⵙᗯⵙᔓᔕⵙᑐᑕⵙ⠀◯⠀ⵙᔓᔕⵙᗱᗴ✤ⵙᗩⵙИNⵙꖴⵙᗝⵙᴥⵙⓄⵙᑐᑕⵙ⠀◯⠀ⵙ✤ⵙИNⵙꖴⵙⓄⵙߦⵙ⠀◯⠀ⵙᗱᗴⵙᗯⵙᴥⵙᑎⵙᑐᑕⵙ⠀◯⠀ⵙ⠀◯⠀ⵙᑐᑕⵙᑎⵙᴥⵙᗯⵙᗱᗴⵙ⠀◯⠀ⵙߦⵙⓄⵙꖴⵙИNⵙ✤ⵙ⠀◯⠀ⵙᑐᑕⵙⓄⵙᴥⵙᗝⵙꖴⵙИNⵙᗩⵙ✤ᗱᗴⵙᔓᔕⵙ⠀◯⠀ⵙᑐᑕⵙᔓᔕⵙᗯⵙ⠀◯⠀ⵙꗳⵙⓄⵙᴥⵙ⠀◯⠀ⵙᙏⵙᗱᗴⵙᙁⵙᗝⵙᗩⵙ⠀◯⠀ⵙߦⵙᴥⵙⓄⵙᗝⵙᑎⵙᑐᑕⵙ✤ⵙꖴⵙⓄⵙИNⵙ⠀.GHX (Grasshopper 1.0.7)

digit_scroller = DigitScroller(Scroller_Digits=12, Scroller_Prefix=" ", Scroller_Radix=11, Scroller_Value=256)
arc = Arc(Plane=Plane(origin=(0.5, 1, 0), x=(0, -1, 0), y=(1, 0, 0)), Radius=0.5, Angle=Domain(0, 1.570796327))  # -> Arc, Length
arc_2 = Arc(Plane=Plane(origin=(0.5, 0, 0), x=(0, 1, 0), y=(-1, 0, 0)), Radius=0.5, Angle=Domain(0, 1.570796327))  # -> Arc, Length
join_curves = JoinCurves(Curves=[arc.Arc, arc_2.Arc], Preserve=False)
file_path = FilePath("C:\VSC.XHG.O____NOITCUDORPADLEM_ROF_WSC_SETANIDROC_TNIOP_EWRUC____O____CURWE_POINT_CORDINATES_CSW_FOR_MELDAPRODUCTION____O.GHX.CSV")
curve = Curve(join_curves)
divide_curve = DivideCurve(Curve=curve, Count=expr("X-1", digit_scroller), Kinks=False)  # -> Points, Tangents, Parameters
deconstruct = Deconstruct(Point=divide_curve.Points)  # -> graft(XComponent), graft(YComponent), graft(ZComponent)
expression = Expression(O=deconstruct.YComponent, Expression="FORMAT(\"{0:0.000000}\",O)")
expression_2 = Expression(O=deconstruct.XComponent, Expression="FORMAT(\"{0:0.000000}\",O)")
panel = Panel(expression)
panel_2 = Panel(expression_2)
concatenate = Concatenate(FragmentA=panel_2, FragmentB=";", FragmentA_2=panel)
panel_3 = Panel(concatenate)
txtwriter = VBScript(filePath=file_path, data=flatten(panel_3), activate=Button())  # -> out, A; inputs data: list
# ---------- txtwriter: VB ----------
    If activate Then

      Dim i As Integer
      Dim aryText(4) As String

      aryText(0) = "Mary WriteLine"
      aryText(1) = "Had"
      aryText(2) = "Another"
      aryText(3) = "Little"
      aryText(4) = "One"

      ' the data is appended to the file. If file doesnt exist, a new file is created
      Dim objWriter As New System.IO.StreamWriter(filePath, append)

      For i = 0 To data.Count - 1
        objWriter.WriteLine(data(i))
      Next

      objWriter.Close()

    End If

    If clearFile Then
      Dim objWriter As New System.IO.StreamWriter(filePath, False)
      objWriter.Close()
    End If
# ---------- end txtwriter ----------
