# Grasshopper definition XHG.⠀⠀⠀⠀ⵙᗱᗴⵙᴥⵙᗱᗴⵙ옷ⵙߦⵙᔓᔕⵙ⠀◯⠀ⵙᴥⵙᗩⵙᙁⵙⓄⵙߦ⠀◯⠀ⵙИNⵙⓄⵙᴥⵙᗝⵙᗱᗴⵙ옷ⵙᗩⵙᑐᑕⵙᗱᗴⵙᗝⵙⓄⵙᗝⵙ⠀◯⠀ⵙᑐᑕⵙꖴⵙ8ⵙᙏⵙⓄⵙ옷ⵙᴥⵙ⠀⠀⠀⠀◯⠀⠀⠀⠀ⵙ⠀⠀⠀⠀◯⠀⠀⠀⠀ⵙᴥⵙ옷ⵙⓄⵙᙏⵙ8ⵙꖴⵙᑐᑕⵙ⠀◯⠀ⵙᗝⵙⓄⵙᗝⵙᗱᗴⵙᑐᑕⵙᗩⵙ옷ⵙᗱᗴⵙᗝⵙᴥⵙⓄⵙИNⵙ⠀◯⠀ߦⵙⓄⵙᙁⵙᗩⵙᴥⵙ⠀◯⠀ⵙᔓᔕⵙߦⵙ옷ⵙᗱᗴⵙᴥⵙᗱᗴⵙ⠀⠀⠀⠀.GHX (Grasshopper 1.0.7)
# plug-ins: Heteroptera, Pufferfish

digit_scroller = DigitScroller(Scroller_Digits=12, Scroller_Prefix="Digit Scroller", Scroller_Radix=11, Scroller_Value=1)
plane_surface = PlaneSurface(Plane=Plane(origin=(0, 1, 0), x=(0, 0, 1), y=(1, 0, 0)), XSize=Domain(-1, 1), YSize=Domain(-1, 1))
center = Center(Geometric=plane_surface, referenceAll=0)  # -> Center, Dimension
plane_surface_2 = PlaneSurface(Plane=PlaneXY(0, 0, 1), XSize=Domain(-1, 1), YSize=Domain(-1, 1))
center_2 = Center(Geometric=plane_surface_2, referenceAll=0)  # -> Center, Dimension
rectangle = Rectangle(plane_surface_2)
explode = Explode(Curve=rectangle, Recursive=True)  # -> Segments, Vertices
quad_sphere = QuadSphere(Base=PlaneXY(0, 0, 0), Radius=1)
deconstruct_brep = DeconstructBrep(Brep=quad_sphere)  # -> Faces, Edges, Vertices
list_item = ListItem(List=explode.Segments, Index=3, Wrap=False)
divide_curve = DivideCurve(Curve=list_item, Count=digit_scroller, Kinks=False)  # -> Points, Tangents, Parameters
list_item_2 = ListItem(List=deconstruct_brep.Faces, Index=0, Wrap=False)
list_length = ListLength(List=divide_curve.Points)
duplicate_data = DuplicateData(Data=center_2.Center, Number=list_length, Order=True)
line = Line(StartPoint=center_2.Center, EndPoint=divide_curve.Points)
line_2 = Line(StartPoint=center.Center, EndPoint=divide_curve.Points)
duplicate_data_2 = DuplicateData(Data=center.Center, Number=list_length, Order=True)
entwine = Entwine(Branch00=duplicate_data, Branch01=divide_curve.Points, Branch02=duplicate_data_2, FlattenInputs=True)
flip_matrix = FlipMatrix(Data=entwine)
digit_scroller_2 = DigitScroller(Scroller_Digits=12, Scroller_Prefix="Digit Scroller", Scroller_Radix=9, Scroller_Value=1)
interpolate = Interpolate(Vertices=flip_matrix, Degree=1, Periodic=False, KnotStyle=1)  # -> Curve, Length, Domain
nurbs_curve = NurbsCurve(Vertices=flip_matrix, Degree=11, Periodic=False)  # -> Curve, Length, Domain
digit_scroller_3 = DigitScroller(Scroller_Digits=12, Scroller_Prefix="Digit Scroller", Scroller_Radix=11, Scroller_Value=89)
pull_curve = PullCurve(Curve=interpolate.Curve, Surface=list_item_2)
prude_curve = PrudeCurve(Curve=nurbs_curve.Curve, Length=65536, BlendType=1, Bulge=Slider(1, range=0..1))  # -> Prude, ResultBoolean
pull_curve_2 = PullCurve(Curve=prude_curve.Prude, Surface=list_item_2)
polar_array = PolarArray(Geometry=pull_curve_2, Plane=PlaneXY(0, 0, 0), Count=4, Angle=6.283185307)  # -> Geometry, Transform
range = Range(Domain=Domain(0, 1), Steps=digit_scroller)
evaluate_length = EvaluateLength(Curve=pull_curve_2, Length=range, Normalized=True)  # -> Point, Tangent, Parameter
evaluate_length_2 = EvaluateLength(Curve=pull_curve, Length=range, Normalized=True)  # -> Point, Tangent, Parameter
curvature_graph = CurvatureGraph(Curve=pull_curve_2, Density=1, Scale=digit_scroller_3)
flip_matrix_2 = FlipMatrix(Data=evaluate_length.Point)
flip_matrix_3 = FlipMatrix(Data=evaluate_length_2.Point)
interpolate_2 = Interpolate(Vertices=flip_matrix_2, Degree=3, Periodic=False, KnotStyle=2)  # -> Curve, Length, Domain
digit_scroller_4 = DigitScroller(Scroller_Digits=12, Scroller_Prefix="Digit Scroller", Scroller_Radix=11, Scroller_Value=15)
pull_curve_3 = PullCurve(Curve=interpolate_2.Curve, Surface=list_item_2)
polar_array_2 = PolarArray(Geometry=pull_curve_3, Plane=PlaneXY(0, 0, 0), Count=4, Angle=6.283185307)  # -> Geometry, Transform
polar_array_3 = PolarArray(Geometry=pull_curve_3, Plane=PlaneXY(0, 0, 0), Count=4, Angle=6.283185307)  # -> Geometry, Transform
interpolate_3 = Interpolate(Vertices=flip_matrix_3, Degree=3, Periodic=False, KnotStyle=2)  # -> Curve, Length, Domain
list_item_3 = ListItem(Index=digit_scroller_4, Wrap=False)
connect_curves = ConnectCurves(Curves=polar_array_3.Geometry, Continuity=2, Close=True, Bulge=Slider(0.5, range=0..1))
polar_array_4 = PolarArray(Geometry=[interpolate_3.Curve, pull_curve], Plane=PlaneXY(0, 0, 0), Count=4, Angle=6.283185307)  # -> Geometry, Transform
plane_surface_3 = PlaneSurface(Plane=PlaneYZ(0, 0, 0), XSize=Domain(-1, 1), YSize=Domain(-1, 1))
list_length_2 = ListLength(List=flatten(connect_curves))
polar_array_5 = PolarArray(Geometry=plane_surface_3, Plane=PlaneXY(0, 0, 0), Count=expr("X*4", digit_scroller), Angle=6.283185307)  # -> Geometry, Transform
yz_plane = YZPlane(Origin=Point(0, 0, 0))
xz_plane = XZPlane(Origin=Point(0, 0, 0))
mirror = Mirror(Geometry=polar_array_4.Geometry, Plane=PlaneXY(0, 0, 0))  # -> Geometry, Transform
list_item_4 = ListItem(List=flatten(connect_curves), Index=expr("X-1", list_length_2), Wrap=False)
dot_display = DotDisplay(Point=list_item_3, Colour=RGB(0, 0, 0), Size=0.0625)  # disabled
rotate = Rotate(Geometry=flatten([polar_array_4.Geometry, mirror.Geometry]), Angle=1.570796327, Plane=graft([yz_plane, xz_plane]))  # -> Geometry, Transform
range_2 = Range(Domain=Domain(0, 0.5), Steps=expr("X/2", 10))
surface_split = SurfaceSplit(Surface=list_item_2, Curves=list_item_4)
list_item_5 = ListItem(List=flatten(surface_split), Index=0, Wrap=False)
brep_plane = BrepPlane(Brep=list_item_5, Plane=plane_surface_3)  # -> Curves, Points
line_sdl = LineSDL(Start=Point(0, 0, 0), Direction=Vector(0, 0, 1), Length=1)
brep_plane_2 = BrepPlane(Brep=list_item_5, Plane=polar_array_5.Geometry)  # -> Curves, Points; disabled
evaluate_length_3 = EvaluateLength(Curve=brep_plane.Curves, Length=range_2, Normalized=True)  # -> Point, Tangent, Parameter
merge = Merge(Data1=polar_array_4.Geometry, Data2=mirror.Geometry, Data3=rotate.Geometry)  # -> flatten(Result)
curve_closest_point = CurveClosestPoint(Point=evaluate_length_3.Point, Curve=line_sdl)  # -> Point, Parameter, Distance
distance = Distance(PointA=curve_closest_point.Point, PointB=evaluate_length_3.Point)
interpolate_4 = Interpolate(Degree=3, Periodic=False, KnotStyle=1)  # -> Curve, Length, Domain; disabled
clean_tree = CleanTree(RemoveNulls=True, RemoveInvalid=True, RemoveEmpty=True, Tree=merge)
circle_cnr = CircleCNR(Center=curve_closest_point.Point, Normal=Vector(0, 0, 1), Radius=distance)
list_item_6 = ListItem(List=clean_tree, Index=[24, 25], Wrap=False)
list_item_7 = ListItem(List=deconstruct_brep.Faces, Index=0, Wrap=False)
digit_scroller_5 = DigitScroller(Scroller_Digits=12, Scroller_Prefix="Digit Scroller", Scroller_Radix=11, Scroller_Value=2)
join_curves = JoinCurves(Curves=list_item_6, Preserve=False)
curve_middle = CurveMiddle(Curve=list_item_6)
list_item_8 = ListItem(List=deconstruct_brep.Edges, Index=2, Wrap=False)
curve_middle_2 = CurveMiddle(Curve=list_item_8)
surface_split_2 = SurfaceSplit(Surface=list_item_7, Curves=join_curves)  # -> flatten(Fragments)
geometry = Geometry(plane_surface_3)
plane_surface_4 = PlaneSurface(Plane=Plane(origin=(0, 0, 0), x=(0.7071067812, 0.7071067812, 0), y=(0, 0, 1)), XSize=Domain(-1, 1), YSize=Domain(-1, 1))
list_item_9 = ListItem(List=surface_split_2, Index=0, Wrap=False)
split_brep = SplitBrep(Brep=list_item_9, Cutter=geometry)
list_item_10 = ListItem(List=split_brep, Index=0, Wrap=False)
digit_scroller_6 = DigitScroller(Scroller_Digits=12, Scroller_Prefix="Digit Scroller", Scroller_Radix=11, Scroller_Value=6)
digit_scroller_7 = DigitScroller(Scroller_Digits=12, Scroller_Prefix="Digit Scroller", Scroller_Radix=11, Scroller_Value=10)
line_3 = Line(StartPoint=Point(0, 0, 0), EndPoint=curve_middle_2)
plane_surface_5 = PlaneSurface(Plane=Plane(origin=(0, 0, 0), x=(1, 0, 0), y=(0, 0.7071067812, 0.7071067812)), XSize=Domain(-1, 1), YSize=Domain(-1, 1))
digit_scroller_8 = DigitScroller(Scroller_Digits=12, Scroller_Prefix="Digit Scroller", Scroller_Radix=11, Scroller_Value=4)
range_3 = Range(Domain=Domain(0, 1), Steps=expr("2^X", digit_scroller_8))
evaluate_length_4 = EvaluateLength(Curve=join_curves, Length=range_3, Normalized=True)  # -> Point, Tangent, Parameter
plane_3pt = Plane3Pt(PointA=Point(0, 0, 0), PointB=curve_middle_2, PointC=evaluate_length_4.Point)
range_4 = Range(Domain=Domain(0, 1), Steps=expr("2^(X-1)", digit_scroller_8))
brep_plane_3 = BrepPlane(Brep=list_item_10, Plane=plane_3pt)  # -> Curves, Points
evaluate_length_5 = EvaluateLength(Curve=brep_plane_3.Curves, Length=range_4, Normalized=True)  # -> Point, Tangent, Parameter
list_length_3 = ListLength(List=flatten(brep_plane_3.Curves))
range_5 = Range(Domain=Domain(0, 1), Steps=expr("2^(X-1)", digit_scroller_8))
list_item_11 = ListItem(List=flatten(brep_plane_3.Curves), Index=0, Wrap=False)
series = Series(Start=1, Step=1, Count=expr("X-2", list_length_3))
list_item_12 = ListItem(List=flatten(brep_plane_3.Curves), Index=series, Wrap=False)
flip_curve = FlipCurve(Curve=list_item_11)  # -> Curve, Flag
merge_2 = Merge(Data1=list_item_12, Data2=flip_curve.Curve)  # -> flatten(Result)
evaluate_length_6 = EvaluateLength(Curve=graft(merge_2), Length=range_5, Normalized=True)  # -> Point, Tangent, Parameter
panel = Panel(evaluate_length_6.Point)
interpolate_5 = Interpolate(Vertices=evaluate_length_5.Point, Degree=1, Periodic=False, KnotStyle=1)  # -> Curve, Length, Domain
flip_matrix_4 = FlipMatrix(Data=evaluate_length_6.Point)
stream_filter = StreamFilter(Gate=Slider(0, range=0..1), Stream0=merge_2, Stream1=interpolate_5.Curve)
shift_list = ShiftList(List=flip_matrix_4, Shift=1, Wrap=True)
interpolate_6 = Interpolate(Vertices=shift_list, Degree=3, Periodic=False, KnotStyle=2)  # -> Curve, Length, Domain
pull_curve_4 = PullCurve(Curve=interpolate_6.Curve, Surface=list_item_2)  # disabled
merge_3 = Merge(Data1=stream_filter, Data2=interpolate_6.Curve)
mirror_2 = Mirror(Geometry=merge_3, Plane=PlaneYZ(0, 0, 0))  # -> Geometry, Transform
merge_4 = Merge(Data1=merge_3, Data2=mirror_2.Geometry)
mirror_3 = Mirror(Geometry=merge_4, Plane=plane_surface_5)  # -> Geometry, Transform
merge_5 = Merge(Data1=merge_4, Data2=mirror_3.Geometry)
polar_array_6 = PolarArray(Geometry=merge_5, Plane=PlaneXY(0, 0, 0), Count=4, Angle=6.283185307)  # -> Geometry, Transform
rotate_2 = Rotate(Geometry=merge_5, Angle=1.570796327, Plane=Plane(origin=(0, 0, 0), x=(0, 0, 1), y=(1, 0, 0)))  # -> Geometry, Transform
mirror_4 = Mirror(Geometry=polar_array_6.Geometry, Plane=PlaneXY(0, 0, 0))  # -> Geometry, Transform
polar_array_7 = PolarArray(Geometry=rotate_2.Geometry, Plane=PlaneXY(0, 0, 0), Count=4, Angle=6.283185307)  # -> Geometry, Transform
merge_6 = Merge(Data1=polar_array_7.Geometry, Data2=polar_array_6.Geometry, Data3=mirror_4.Geometry)
