# Grasshopper definition XHG.⚪ᗩ⚪ᑐᑕ⚪ꖴ⚪✤⚪ᗩ⚪ᙏ⚪ᗱᗴ⚪옷⚪✤⚪ᗩ⚪ᙏ⚪◌⚪◌⚪◌⚪◌⚪◌⚪◌⚪ᙏ⚪ᗩ⚪✤⚪옷⚪ᗱᗴ⚪ᙏ⚪ᗩ⚪✤⚪ꖴ⚪ᑐᑕ⚪ᗩ⚪.GHX (Grasshopper 1.0.7)
# plug-ins: WolframComponents

panel = Panel("ToString[DecimalForm[N[Table[{ToString[DecimalForm[N[Cos[t]],256]],ToString[DecimalForm[N[Sin[t]],256]],ToString[DecimalForm[N[0],256]]},{t,0,N[2*Pi],N[Pi/4]}]],256]]")
panel_2 = Panel("""ariasD[0] = 1;
ariasD[n_Integer?Positive] := ariasD[n] = Sum[2^((k (k - 1) - n (n - 1))/2) ariasD[k]/(n - k + 1)!, {k, 0, n - 1}]/(2^n - 1);
iFabiusF[x_]:=Module[{prec=Precision[x],n,p,q,s,tol,w,y,z},If[x<0,Return[0,Module]];tol=10^(-prec);
z=SetPrecision[x,Infinity];s=1;y=0;
z=If[0<=z<=2,1-Abs[1-z],q=Quotient[z,2];
If[ThueMorse[q]==1,s=-1];
1-Abs[1-z+2 q]];
While[z>0,n=-Floor[RealExponent[z,2]];p=2^n;
z-=1/p;w=1;
Do[w=ariasD[m]+p z w/(n-m+1);p/=2,{m,n}];
y=w-y;
If[Abs[w]<Abs[y] tol,Break[]]];
SetPrecision[s Abs[y],prec]];
FabiusF[Infinity] = Interval[{-1, 1}];
FabiusF[x_?NumberQ] /; If[Im[x] == 0, TrueQ[Composition[BitAnd[#, # - 1] &, Denominator][x] == 0], False] := iFabiusF[x];
Derivative[n_Integer][FabiusF] := 2^(n (n + 1)/2) FabiusF[2^n #] &;
SetAttributes[FabiusF, {NumericFunction, Listable}];//Timing//AbsoluteTiming;

ToString[DecimalForm[N[Table[{ToString[DecimalForm[N[X],256]],ToString[DecimalForm[N[FabiusF[X]],256]],ToString[DecimalForm[N[0],256]]},{X,0,N[1],N[1/16]}]],256]]""")
wl_code = WLCode(Expr=panel_2)  # -> Result, Expr, Link
panel_3 = Panel(wl_code.Result)
replace_text = ReplaceText(Text=wl_code.Result, Find="}, {", Replace=";", RecursiveReplace=False)
text_split = TextSplit(Text=replace_text, Separators=";")
replace_text_2 = ReplaceText(Text=text_split, Find="{", RecursiveReplace=False)
replace_text_3 = ReplaceText(Text=replace_text_2, Find="}", RecursiveReplace=False)
point = Point(replace_text_3)
clean_tree = CleanTree(RemoveNulls=True, RemoveInvalid=True, RemoveEmpty=True, Tree=point)
format = Format(Format="{0:R}", Culture=127, Data0=point)
panel_5 = Panel(format)
panel_6 = Panel(clean_tree)
number = Number(format)
text = Text(point)
panel_7 = Panel(replace_text_3)
