# Grasshopper definition XHG.....ⵙ꞉ⵙ◯ⵙᗱᗴⵙᗯⵙᴥⵙᑎⵙᑐᑕⵙ◯ⵙИNⵙⓄⵙꖴⵙ✤ⵙꖴⵙᔓᔕⵙИNⵙᗩⵙᴥⵙ✤ⵙ◯ⵙꗳⵙᙁⵙᗱᗴⵙᔓᔕⵙ◯ⵙᙁⵙᗩⵙᗱᗴⵙᗝⵙꖴⵙ⊚ⵙ◌ⵙ⊚ⵙ◌ⵙ⊚ⵙ◌ⵙ⚪ⵙ◯ⵙ◯ⵙ⚪ⵙ◌ⵙ⊚ⵙ◌ⵙ⊚ⵙ◌ⵙ⊚ⵙꖴⵙᗝⵙᗱᗴⵙᗩⵙᙁⵙ◯ⵙᔓᔕⵙᗱᗴⵙᙁⵙꗳⵙ◯ⵙ✤ⵙᴥⵙᗩⵙИNⵙᔓᔕⵙꖴⵙ✤ⵙꖴⵙⓄⵙИNⵙ◯ⵙᑐᑕⵙᑎⵙᴥⵙᗯⵙᗱᗴⵙ◯ⵙ꞉ⵙ.....GHX (Grasshopper 1.0.7)
# plug-ins: Palette

digit_scroller = DigitScroller(Scroller_Digits=12, Scroller_Prefix=" ", Scroller_Radix=1, Scroller_Value=8)
digit_scroller_2 = DigitScroller(Scroller_Digits=12, Scroller_Prefix=" ", Scroller_Radix=7, Scroller_Value=0)
digit_scroller_3 = DigitScroller(Scroller_Digits=12, Scroller_Prefix=" ", Scroller_Radix=1, Scroller_Value=7)
digit_scroller_4 = DigitScroller(Scroller_Digits=12, Scroller_Prefix=" ", Scroller_Radix=6, Scroller_Value=0)
digit_scroller_5 = DigitScroller(Scroller_Digits=12, Scroller_Prefix=" ", Scroller_Radix=1, Scroller_Value=6)
digit_scroller_6 = DigitScroller(Scroller_Digits=12, Scroller_Prefix=" ", Scroller_Radix=6, Scroller_Value=0)
digit_scroller_7 = DigitScroller(Scroller_Digits=12, Scroller_Prefix=" ", Scroller_Radix=1, Scroller_Value=5)
digit_scroller_8 = DigitScroller(Scroller_Digits=12, Scroller_Prefix=" ", Scroller_Radix=5, Scroller_Value=0)
digit_scroller_9 = DigitScroller(Scroller_Digits=12, Scroller_Prefix=" ", Scroller_Radix=1, Scroller_Value=4)
digit_scroller_10 = DigitScroller(Scroller_Digits=12, Scroller_Prefix=" ", Scroller_Radix=5, Scroller_Value=0)
digit_scroller_11 = DigitScroller(Scroller_Digits=12, Scroller_Prefix=" ", Scroller_Radix=1, Scroller_Value=3)
digit_scroller_12 = DigitScroller(Scroller_Digits=12, Scroller_Prefix=" ", Scroller_Radix=4, Scroller_Value=0)
digit_scroller_13 = DigitScroller(Scroller_Digits=12, Scroller_Prefix=" ", Scroller_Radix=1, Scroller_Value=2)
digit_scroller_14 = DigitScroller(Scroller_Digits=12, Scroller_Prefix=" ", Scroller_Radix=4, Scroller_Value=0.02)
digit_scroller_15 = DigitScroller(Scroller_Digits=12, Scroller_Prefix=" ", Scroller_Radix=1, Scroller_Value=1)
digit_scroller_16 = DigitScroller(Scroller_Digits=12, Scroller_Prefix=" ", Scroller_Radix=3, Scroller_Value=0.4)
digit_scroller_17 = DigitScroller(Scroller_Digits=12, Scroller_Prefix=" ", Scroller_Radix=1, Scroller_Value=0)
digit_scroller_18 = DigitScroller(Scroller_Digits=12, Scroller_Prefix=" ", Scroller_Radix=3, Scroller_Value=0.19)
colour_swatch = ColourSwatch(SwatchColor=RGB(255, 255, 255))
colour_swatch_2 = ColourSwatch(SwatchColor=RGB(227, 227, 227))
colour_swatch_3 = ColourSwatch(SwatchColor=RGB(115, 115, 115))
colour_swatch_4 = ColourSwatch(SwatchColor=RGB(209, 209, 209))
colour_swatch_5 = ColourSwatch(SwatchColor=RGB(222, 222, 222))
colour_swatch_6 = ColourSwatch(SwatchColor=RGB(168, 168, 168))
palette = Palette(
    ModeCustomStandard=True,
    Component_Normal_Deselected_Fill_Color=colour_swatch,
    Component_Normal_Deselected_Edge_Color=colour_swatch_4,
    Component_Normal_Deselected_Text_Color=colour_swatch_3,
    Component_Normal_Selected_Fill_Color=colour_swatch_2,
    Component_Normal_Selected_Edge_Color=colour_swatch_4,
    Component_Normal_Selected_Text_Color=colour_swatch_3,
    Component_Hidden_Deselected_Fill_Color=colour_swatch,
    Component_Hidden_Deselected_Edge_Color=colour_swatch_4,
    Component_Hidden_Deselected_Text_Color=colour_swatch_3,
    Component_Hidden_Selected_Fill_Color=colour_swatch_2,
    Component_Hidden_Selected_Edge_Color=colour_swatch_4,
    Component_Hidden_Selected_Text_Color=colour_swatch_3,
    Component_Disabled_Deselected_Fill_Color=ColourSwatch(SwatchColor=RGB(196, 196, 196)),
    Component_Disabled_Deselected_Edge_Color=colour_swatch_4,
    Component_Disabled_Deselected_Text_Color=colour_swatch_3,
    Component_Disabled_Selected_Fill_Color=ColourSwatch(SwatchColor=RGB(176, 176, 176)),
    Component_Disabled_Selected_Edge_Color=colour_swatch_4,
    Component_Disabled_Selected_Text_Color=colour_swatch_3,
    Component_Warning_Deselected_Fill_Color=colour_swatch,
    Component_Warning_Deselected_Edge_Color=colour_swatch_4,
    Component_Warning_Deselected_Text_Color=colour_swatch_3,
    Component_Warning_Selected_Fill_Color=colour_swatch_2,
    Component_Warning_Selected_Edge_Color=colour_swatch_4,
    Component_Warning_Selected_Text_Color=colour_swatch_3,
    Component_Error_Deselected_Fill_Color=colour_swatch,
    Component_Error_Deselected_Edge_Color=colour_swatch_4,
    Component_Error_Deselected_Text_Color=colour_swatch_3,
    Component_Error_Selected_Fill_Color=RGB(255, 255, 255),
    Component_Error_Selected_Edge_Color=colour_swatch_4,
    Component_Error_Selected_Text_Color=colour_swatch_3,
    Component_Label_Deselected_Fill_Color=RGB(50, 50, 50),
    Component_Label_Deselected_Edge_Color=colour_swatch_4,
    Component_Label_Deselected_Text_Color=colour_swatch_3,
    Component_Label_Selected_Fill_Color=RGB(25, 60, 25),
    Component_Label_Selected_Edge_Color=colour_swatch_4,
    Component_Label_Selected_Text_Color=colour_swatch_3,
    Galapagos_Deselected_Fill_Color=RGB(252, 252, 252),
    Galapagos_Deselected_Edge_Color=colour_swatch_4,
    Galapagos_Selected_Fill_Color=RGB(255, 255, 255),
    Galapagos_Selected_Edge_Color=colour_swatch_4,
    Wire_Normal_Color=colour_swatch_5,
    Wire_Empty_Color=colour_swatch_5,
    Wire_Selected_Start_Color=colour_swatch_6,
    Wire_Selected_End_Color=colour_swatch_6,
    Panel_Default_Color=RGB(255, 255, 255),
    Group_Default_Color=RGB(255, 255, 255),
    Canvas_Background_Color=RGB(255, 255, 255),
    Canvas_Gridline_Color=RGB(240, 240, 240),
    Canvas_Gridline_Width=2,
    Canvas_Gridline_Height=2,
    Canvas_Edge_Color=RGB(207, 207, 207),
    Canvas_Shadow_Color=RGBA(237, 237, 237, 0),
    Canvas_Shadow_Size=2,
    MonochromaticOnOff=False,
    Monochromatic_Color=RGB(255, 255, 255))
infoglasses = InfoGlasses(
    Run=True,
    Language=0,
    BackGroundColor=RGB(255, 255, 255),
    BoundaryColor=RGB(115, 115, 115),
    English=True,
    FullName_Category=True,
    Merge_Box=True,
    TextColor=RGB(59, 59, 59),
    assemBoxWidth=1000,
    assemFontSize=8,
    assemSet=False,
    assemboxHeight=0,
    autoHeight=False,
    avoidPro=True,
    cateSet=False,
    highLightRadius=2,
    nameBoxDistance=1,
    nameBoxFontSize=8,
    showName=False,
    showNickName=False,
    showPlugin=False)
create_material = CreateMaterial(Diffuse=RGB(207, 207, 207), Specular=RGB(0, 255, 255), Emission=RGB(0, 0, 0), Transparency=0.5, Shine=100)  # disabled
create_material_2 = CreateMaterial(Diffuse=RGB(232, 232, 232), Specular=RGB(0, 255, 255), Emission=RGB(0, 0, 0), Transparency=0.5, Shine=100)  # disabled
derivatives = Derivatives()  # -> Point, FirstDerivative, SecondDerivative, ThirdDerivative, FourthDerivative, FifthDerivative, SixthDerivative; disabled
line_sdl = LineSDL(Direction=derivatives.ThirdDerivative, Length=expr("-X", 1))  # disabled
evaluate_length = EvaluateLength(Curve=line_sdl, Length=1, Normalized=True)  # -> Point, Tangent, Parameter; disabled
interpolate = Interpolate(Vertices=evaluate_length.Point, Degree=3, Periodic=False, KnotStyle=2)  # -> Curve, Length, Domain; disabled
quick_graph = QuickGraph(derivatives.SixthDerivative, SortOrder=0)  # disabled
quick_graph_2 = QuickGraph(derivatives.FifthDerivative, SortOrder=0)  # disabled
quick_graph_3 = QuickGraph(derivatives.FourthDerivative, SortOrder=0)  # disabled
quick_graph_4 = QuickGraph(derivatives.ThirdDerivative, SortOrder=0)  # disabled
quick_graph_5 = QuickGraph(derivatives.SecondDerivative, SortOrder=0)  # disabled
quick_graph_6 = QuickGraph(derivatives.FirstDerivative, SortOrder=0)  # disabled
quick_graph_7 = QuickGraph(derivatives.Point, SortOrder=0)  # disabled
custom_preview = CustomPreview(Geometry=interpolate.Curve, Material=create_material)  # disabled
custom_preview_2 = CustomPreview(Geometry=line_sdl, Material=create_material_2)  # disabled
increase_bend_per_segment = DigitScroller(Scroller_Digits=12, Scroller_Prefix="INCREASE BEND PER SEGMENT", Scroller_Radix=1, Scroller_Value=0.5154225631)

number_of_segments = DigitScroller(Scroller_Digits=12, Scroller_Prefix="NUMBER OF SEGMENTS", Scroller_Radix=11, Scroller_Value=512)

number = Number(number_of_segments)
number_2 = Number(expr("X*2+1", number))
number_3 = Number(expr("X*2+1", number))
one_over_x = OneOverX(Value=number_of_segments)
unit_y = UnitY(Factor=one_over_x)

addition = Addition(A="1", B=number_of_segments)
addition_2 = Addition(A="1", B=addition)

panel = Panel("0.492221738454693386")
panel_2 = Panel("0.51542256311")
log_n = LogN(Number=number_of_segments, Base=2)
expression = Expression(O=increase_bend_per_segment, OO=log_n, Expression="O/4^(OO-4)")

unit_z = UnitZ(Factor=one_over_x)
sement_length = DigitScroller(Scroller_Digits=12, Scroller_Prefix="SEMENT LENGTH", Scroller_Radix=2, Scroller_Value=0.0023)
increase_bend_per_segment_2 = DigitScroller(Scroller_Digits=12, Scroller_Prefix="INCREASE BEND PER SEGMENT", Scroller_Radix=1, Scroller_Value=0.4922217385)
unit_x = UnitX(Factor=one_over_x)
series = Series(Start=0, Step=expression, Count=addition_2)
ᔓᔕ_ᙁ_ᗩ_ᴥ_ᗩ_ᑫᑭ_иn_ᗝ_ᗩ_ᔓᔕ_ᗩ_ᙏ_ᙏ_ᗩ_ᔓᔕ_ᗩ_ᗝ_и = ᔓᔕᙁᗩᴥᗩᑫᑭИNᗝᗩᔓᔕᗩᙏᙏᗩᔓᔕᗩᗝИNᑫᑭᗩᴥᗩᙁᔓᔕ(shift=1, relay=series)  # -> relay_2, result
rotate = Rotate(Vector=unit_y, Axis=unit_z, Angle=expr("-X", reverse(degrees(ᔓᔕ_ᙁ_ᗩ_ᴥ_ᗩ_ᑫᑭ_иn_ᗝ_ᗩ_ᔓᔕ_ᗩ_ᙏ_ᙏ_ᗩ_ᔓᔕ_ᗩ_ᗝ_и.relay_2))))
ᔓᔕ_ᙁ_ᗩ_ᴥ_ᗩ_ᑫᑭ_иn_ᗝ_ᗩ_ᔓᔕ_ᗩ_ᙏ_ᙏ_ᗩ_ᔓᔕ_ᗩ_ᗝ_и_2 = ᔓᔕᙁᗩᴥᗩᑫᑭИNᗝᗩᔓᔕᗩᙏᙏᗩᔓᔕᗩᗝИNᑫᑭᗩᴥᗩᙁᔓᔕ(shift=-1, relay=rotate)  # -> relay_2, result
insert_items = InsertItems(List=ᔓᔕ_ᙁ_ᗩ_ᴥ_ᗩ_ᑫᑭ_иn_ᗝ_ᗩ_ᔓᔕ_ᗩ_ᙏ_ᙏ_ᗩ_ᔓᔕ_ᗩ_ᗝ_и_2.relay_2, Item="{0,0,0}", Indices=0, Wrap=False)
interpolate_2 = Interpolate(Vertices=insert_items, Degree=5, Periodic=False, KnotStyle=2)  # -> Curve, Length, Domain

evaluate_length_2 = EvaluateLength(Curve=interpolate_2.Curve, Length=1, Normalized=True)  # -> Point, Tangent, Parameter
rotate_2 = Rotate(Geometry=interpolate_2.Curve, Angle=3.141592654, Plane=evaluate_length_2.Point)  # -> Geometry, Transform
merge = Merge(Data1=interpolate_2.Curve, Data2=rotate_2.Geometry)
join_curves = JoinCurves(Curves=merge, Preserve=False)
evaluate_length_3 = EvaluateLength(Curve=join_curves, Length=1, Normalized=True)  # -> Point, Tangent, Parameter
angle = Angle(VectorA=evaluate_length_3.Tangent, VectorB=Vector(1, 0, 0))  # -> expr("-DEG(X)", Angle), Reflex
rotate_3 = Rotate(Geometry=join_curves, Angle=degrees(angle.Angle), Plane=PlaneXY(0, 0, 0))  # -> Geometry, Transform
curve = Curve(graft(rotate_3.Geometry))
curve_2 = Curve(graft(curve))
diference_curwature_linear_graph = DIFERENCECURWATURELINEARGRAPH(
    y_component=digit_scroller,
    B=digit_scroller_2,
    y_component_2=digit_scroller_3,
    B_2=digit_scroller_4,
    y_component_3=digit_scroller_5,
    B_3=digit_scroller_6,
    y_component_4=digit_scroller_7,
    B_4=digit_scroller_8,
    y_component_5=digit_scroller_9,
    B_5=digit_scroller_10,
    y_component_6=digit_scroller_11,
    B_6=digit_scroller_12,
    y_component_7=digit_scroller_13,
    B_7=digit_scroller_14,
    y_component_8=digit_scroller_15,
    B_8=digit_scroller_16,
    y_component_9=digit_scroller_17,
    B_9=digit_scroller_18,
    count=number_2,
    curve=curve_2)  # disabled

digit_scroller_19 = DigitScroller(Scroller_Digits=12, Scroller_Prefix=" ", Scroller_Radix=3, Scroller_Value=0.019)
digit_scroller_20 = DigitScroller(Scroller_Digits=12, Scroller_Prefix=" ", Scroller_Radix=2, Scroller_Value=0.02)
digit_scroller_21 = DigitScroller(Scroller_Digits=12, Scroller_Prefix=" ", Scroller_Radix=2, Scroller_Value=0.02)
digit_scroller_22 = DigitScroller(Scroller_Digits=12, Scroller_Prefix=" ", Scroller_Radix=1, Scroller_Value=0.021)
digit_scroller_23 = DigitScroller(Scroller_Digits=12, Scroller_Prefix=" ", Scroller_Radix=1, Scroller_Value=0.022)
digit_scroller_24 = DigitScroller(Scroller_Digits=12, Scroller_Prefix=" ", Scroller_Radix=1, Scroller_Value=0.022)
digit_scroller_25 = DigitScroller(Scroller_Digits=12, Scroller_Prefix=" ", Scroller_Radix=1, Scroller_Value=0.022)
digit_scroller_26 = DigitScroller(Scroller_Digits=12, Scroller_Prefix=" ", Scroller_Radix=1, Scroller_Value=0.03)
curve_3 = Curve(graft(curve))
diference_curwature_shaped_graph = DIFERENCECURWATURESHAPEDGRAPH(
    B=digit_scroller_19,
    B_2=digit_scroller_20,
    B_3=digit_scroller_21,
    B_4=digit_scroller_22,
    B_5=digit_scroller_23,
    B_6=digit_scroller_24,
    B_7=digit_scroller_25,
    B_8=digit_scroller_26,
    count=number_3,
    curve=curve_3)

evaluate_length_4 = EvaluateLength(Curve=rotate_3.Geometry, Length=1, Normalized=True)  # -> Point, Tangent, Parameter
deconstruct = Deconstruct(Point=evaluate_length_4.Point)  # -> XComponent, YComponent, ZComponent
panel_3 = Panel("""16    0.492221738454693386
32    0.507180224586""")
format = Format(Format="{0:R}", Culture=127, Data0=deconstruct.XComponent)
format_2 = Format(Format="{0:R}", Culture=127, Data0=deconstruct.YComponent)
division = Division(A=deconstruct.XComponent, B=deconstruct.YComponent)
format_3 = Format(Format="{0:R}", Culture=127, Data0=division)
X = Panel(format)
Y = Panel(format_2)
panel_4 = Panel(format_3)

# ==== cluster ᔓᔕᙁᗩᴥᗩᑫᑭИNᗝᗩᔓᔕᗩᙏᙏᗩᔓᔕᗩᗝИNᑫᑭᗩᴥᗩᙁᔓᔕ

shift = ClusterInput()
relay = ClusterInput()
mass_addition = MassAddition(Input=relay)  # -> Result, PartialResults
shift_list = ShiftList(List=mass_addition.PartialResults, Shift=shift, Wrap=False)
relay_2 = ClusterOutput(shift_list)
result = ClusterOutput(mass_addition.Result)
format = Format(Format="{0:R}", Culture=127, Data0=shift_list)
panel = Panel(format)
format_2 = Format(Format="{0:R}", Culture=127, Data0=mass_addition.PartialResults)
panel_2 = Panel(format_2)
format_3 = Format(Format="{0:R}", Culture=127, Data0=relay)
panel_3 = Panel(format_3)

# ==== cluster DIFERENCECURWATURESHAPEDGRAPH
curve = ClusterInput()
B = ClusterInput()
B_2 = ClusterInput()
B_3 = ClusterInput()
B_4 = ClusterInput()
B_5 = ClusterInput()
B_6 = ClusterInput()
B_7 = ClusterInput()
B_8 = ClusterInput()

digit_scroller = DigitScroller(Scroller_Digits=12, Scroller_Prefix=" ", Scroller_Radix=11, Scroller_Value=87)  # disabled
create_material = CreateMaterial(Diffuse=RGB(222, 222, 222), Specular=RGB(0, 255, 255), Emission=RGB(0, 0, 0), Transparency=0.5, Shine=100)
create_material_2 = CreateMaterial(Diffuse=RGB(247, 247, 247), Specular=RGB(0, 255, 255), Emission=RGB(0, 0, 0), Transparency=0.5, Shine=100)
create_material_3 = CreateMaterial(Diffuse=RGB(176, 176, 176), Specular=RGB(0, 255, 255), Emission=RGB(0, 0, 0), Transparency=0.5, Shine=100)
count = ClusterInput()
curve_2 = Curve(graft(curve))
divide_curve = DivideCurve(Curve=curve_2, Count=count, Kinks=False)  # -> Points, Tangents, Parameters
curvature = Curvature(Curve=curve_2, Parameter=divide_curve.Parameters)  # -> Point, Curvature, Curvature_2
deconstruct_arc = DeconstructArc(Arc=curvature.Curvature_2)  # -> BasePlane, Radius, Angle
line = Line(StartPoint=curvature.Point, EndPoint=deconstruct_arc.BasePlane)
control_points = ControlPoints(Curve=curve_2)  # -> Points, Weights, Knots
list_length = ListLength(List=control_points.Points)  # -> expr("X-1", Length)
curve_degree = CurveDegree(Curve=curve_2)
expression = Expression(A=list_length, B=curve_degree, Expression="A-B+1")
length = Length(Curve=curve_2)
one_over_x = OneOverX(Value=deconstruct_arc.Radius)
expression_2 = Expression(O=one_over_x, Expression="FORMAT(\"{0:R}\",O)")  # disabled
panel = Panel(expression_2)
quick_graph = QuickGraph(one_over_x, SortOrder=0)
bounds = Bounds(Numbers=one_over_x)
remap_numbers = RemapNumbers(Value=one_over_x, Source=bounds, Target=Domain(0, 1))  # -> Mapped, Clipped
curvature_graph = CurvatureGraph(Curve=curve_2, Density=1, Scale=digit_scroller)  # disabled
custom_preview = CustomPreview(Geometry=curve_2, Material=create_material_3)
multiplication = Multiplication(A=length, B=remap_numbers.Mapped)
multiplication_2 = Multiplication(A=multiplication, B=B_8)
line_sdl = LineSDL(Start=curvature.Point, Direction=curvature.Curvature, Length=expr("-X", multiplication_2))
evaluate_length = EvaluateLength(Curve=line_sdl, Length=1, Normalized=True)  # -> Point, Tangent, Parameter
interpolate = Interpolate(Vertices=evaluate_length.Point, Degree=1, Periodic=False, KnotStyle=2)  # -> Curve, Length, Domain
custom_preview_2 = CustomPreview(Geometry=line_sdl, Material=create_material_2)
number = Number(expression)
number_2 = Number(number)
curve_3 = Curve(interpolate.Curve)
custom_preview_3 = CustomPreview(Geometry=curve_3, Material=create_material)

expression_3 = Expression(O=deconstruct_arc.Radius, Expression="FORMAT(\"{0:R}\",O)")  # disabled
panel_2 = Panel(expression_3)

replace_nulls = ReplaceNulls(Items=one_over_x, Replacements=0)  # -> Items, Count
relative_differences = RelativeDifferences(Values=replace_nulls.Items)
list_length_2 = ListLength(List=relative_differences)
series = Series(Start=1, Step=1, Count=expr("X-1", list_length_2))
list_item = ListItem(List=relative_differences, Index=series, Wrap=False)

expression_4 = Expression(O=list_item, Expression="FORMAT(\"{0:R}\",O)")  # disabled
panel_3 = Panel(expression_4)

replace_nulls_2 = ReplaceNulls(Items=list_item, Replacements=0)  # -> Items, Count
relative_differences_2 = RelativeDifferences(Values=replace_nulls_2.Items)
list_length_3 = ListLength(List=relative_differences_2)
series_2 = Series(Start=1, Step=1, Count=expr("X-1", list_length_3))
list_item_2 = ListItem(List=relative_differences_2, Index=series_2, Wrap=False)

expression_5 = Expression(O=list_item_2, Expression="FORMAT(\"{0:R}\",O)")  # disabled
panel_4 = Panel(expression_5)

replace_nulls_3 = ReplaceNulls(Items=list_item_2, Replacements=0)  # -> Items, Count
relative_differences_3 = RelativeDifferences(Values=replace_nulls_3.Items)
list_length_4 = ListLength(List=relative_differences_3)
series_3 = Series(Start=1, Step=1, Count=expr("X-1", list_length_4))
list_item_3 = ListItem(List=relative_differences_3, Index=series_3, Wrap=False)

expression_6 = Expression(O=list_item_3, Expression="FORMAT(\"{0:R}\",O)")  # disabled
panel_5 = Panel(expression_6)

replace_nulls_4 = ReplaceNulls(Items=list_item_3, Replacements=0)  # -> Items, Count
relative_differences_4 = RelativeDifferences(Values=replace_nulls_4.Items)
list_length_5 = ListLength(List=relative_differences_4)
series_4 = Series(Start=1, Step=1, Count=expr("X-1", list_length_5))
list_item_4 = ListItem(List=relative_differences_4, Index=series_4, Wrap=False)

expression_7 = Expression(O=list_item_4, Expression="FORMAT(\"{0:R}\",O)")  # disabled
panel_6 = Panel(expression_7)

replace_nulls_5 = ReplaceNulls(Items=list_item_4, Replacements=0)  # -> Items, Count
relative_differences_5 = RelativeDifferences(Values=replace_nulls_5.Items)
list_length_6 = ListLength(List=relative_differences_5)
series_5 = Series(Start=1, Step=1, Count=expr("X-1", list_length_6))
list_item_5 = ListItem(List=relative_differences_5, Index=series_5, Wrap=False)

expression_8 = Expression(O=list_item_5, Expression="FORMAT(\"{0:R}\",O)")  # disabled
panel_7 = Panel(expression_8)

replace_nulls_6 = ReplaceNulls(Items=list_item_5, Replacements=0)  # -> Items, Count
relative_differences_6 = RelativeDifferences(Values=replace_nulls_6.Items)
list_length_7 = ListLength(List=relative_differences_6)
series_6 = Series(Start=1, Step=1, Count=expr("X-1", list_length_7))
list_item_6 = ListItem(List=relative_differences_6, Index=series_6, Wrap=False)

expression_9 = Expression(O=list_item_6, Expression="FORMAT(\"{0:R}\",O)")  # disabled
panel_8 = Panel(expression_9)

replace_nulls_7 = ReplaceNulls(Items=list_item_6, Replacements=0)  # -> Items, Count
relative_differences_7 = RelativeDifferences(Values=replace_nulls_7.Items)
list_length_8 = ListLength(List=relative_differences_7)
series_7 = Series(Start=1, Step=1, Count=expr("X-1", list_length_8))
list_item_7 = ListItem(List=relative_differences_7, Index=series_7, Wrap=False)

expression_10 = Expression(O=list_item_7, Expression="FORMAT(\"{0:R}\",O)")  # disabled
panel_9 = Panel(expression_10)

explode = Explode(Curve=curve_3, Recursive=True)  # -> Segments, Vertices
evaluate_length_2 = EvaluateLength(Curve=explode.Segments, Length=0.5, Normalized=True)  # -> Point, Tangent, Parameter
curve_closest_point = CurveClosestPoint(Point=evaluate_length_2.Point, Curve=curve_2)  # -> Point, Parameter, Distance
line_2 = Line(StartPoint=curve_closest_point.Point, EndPoint=evaluate_length_2.Point)

bounds_2 = Bounds(Numbers=list_item_7)
remap_numbers_2 = RemapNumbers(Value=list_item_7, Source=bounds_2, Target=Domain(-1, 1))  # -> Mapped, Clipped
multiplication_3 = Multiplication(A=length, B=remap_numbers_2.Mapped)
multiplication_4 = Multiplication(A=multiplication_3, B=B)

bounds_3 = Bounds(Numbers=list_item_6)
remap_numbers_3 = RemapNumbers(Value=list_item_6, Source=bounds_3, Target=Domain(-1, 1))  # -> Mapped, Clipped
multiplication_5 = Multiplication(A=length, B=remap_numbers_3.Mapped)
multiplication_6 = Multiplication(A=multiplication_5, B=B_2)

bounds_4 = Bounds(Numbers=list_item_5)
remap_numbers_4 = RemapNumbers(Value=list_item_5, Source=bounds_4, Target=Domain(-1, 1))  # -> Mapped, Clipped
multiplication_7 = Multiplication(A=length, B=remap_numbers_4.Mapped)
multiplication_8 = Multiplication(A=multiplication_7, B=B_3)

bounds_5 = Bounds(Numbers=list_item_4)
remap_numbers_5 = RemapNumbers(Value=list_item_4, Source=bounds_5, Target=Domain(-1, 1))  # -> Mapped, Clipped
multiplication_9 = Multiplication(A=length, B=remap_numbers_5.Mapped)
multiplication_10 = Multiplication(A=multiplication_9, B=B_4)

bounds_6 = Bounds(Numbers=list_item_3)
remap_numbers_6 = RemapNumbers(Value=list_item_3, Source=bounds_6, Target=Domain(-1, 1))  # -> Mapped, Clipped
multiplication_11 = Multiplication(A=length, B=remap_numbers_6.Mapped)
multiplication_12 = Multiplication(A=multiplication_11, B=B_5)

bounds_7 = Bounds(Numbers=list_item_2)
remap_numbers_7 = RemapNumbers(Value=list_item_2, Source=bounds_7, Target=Domain(-1, 1))  # -> Mapped, Clipped
multiplication_13 = Multiplication(A=length, B=remap_numbers_7.Mapped)
multiplication_14 = Multiplication(A=multiplication_13, B=B_6)

bounds_8 = Bounds(Numbers=list_item)
remap_numbers_8 = RemapNumbers(Value=list_item, Source=bounds_8, Target=Domain(-1, 1))  # -> Mapped, Clipped
multiplication_15 = Multiplication(A=length, B=remap_numbers_8.Mapped)
multiplication_16 = Multiplication(A=multiplication_15, B=B_7)

create_material_4 = CreateMaterial(Diffuse=RGB(214, 214, 214), Specular=RGB(0, 255, 255), Emission=RGB(0, 0, 0), Transparency=0.5, Shine=100)
create_material_5 = CreateMaterial(Diffuse=RGB(240, 240, 240), Specular=RGB(0, 255, 255), Emission=RGB(0, 0, 0), Transparency=0.5, Shine=100)
quick_graph_2 = QuickGraph(list_item, SortOrder=0)
line_sdl_2 = LineSDL(Start=evaluate_length_2.Point, Direction=line_2, Length=expr("ABS(X)", multiplication_16))
evaluate_length_3 = EvaluateLength(Curve=line_sdl_2, Length=1, Normalized=True)  # -> Point, Tangent, Parameter
interpolate_2 = Interpolate(Vertices=evaluate_length_3.Point, Degree=1, Periodic=False, KnotStyle=2)  # -> Curve, Length, Domain
custom_preview_4 = CustomPreview(Geometry=interpolate_2.Curve, Material=create_material_4)
custom_preview_5 = CustomPreview(Geometry=line_sdl_2, Material=create_material_5)

explode_2 = Explode(Curve=interpolate_2.Curve, Recursive=True)  # -> Segments, Vertices
evaluate_length_4 = EvaluateLength(Curve=explode_2.Segments, Length=0.5, Normalized=True)  # -> Point, Tangent, Parameter
curve_closest_point_2 = CurveClosestPoint(Point=evaluate_length_4.Point, Curve=curve_2)  # -> Point, Parameter, Distance
line_3 = Line(StartPoint=curve_closest_point_2.Point, EndPoint=evaluate_length_4.Point)

create_material_6 = CreateMaterial(Diffuse=RGB(207, 207, 207), Specular=RGB(0, 255, 255), Emission=RGB(0, 0, 0), Transparency=0.5, Shine=100)
create_material_7 = CreateMaterial(Diffuse=RGB(232, 232, 232), Specular=RGB(0, 255, 255), Emission=RGB(0, 0, 0), Transparency=0.5, Shine=100)
quick_graph_3 = QuickGraph(list_item_2, SortOrder=0)
line_sdl_3 = LineSDL(Start=evaluate_length_4.Point, Direction=line_3, Length=expr("ABS(X)", multiplication_14))
evaluate_length_5 = EvaluateLength(Curve=line_sdl_3, Length=1, Normalized=True)  # -> Point, Tangent, Parameter
interpolate_3 = Interpolate(Vertices=evaluate_length_5.Point, Degree=1, Periodic=False, KnotStyle=2)  # -> Curve, Length, Domain
custom_preview_6 = CustomPreview(Geometry=interpolate_3.Curve, Material=create_material_6)
custom_preview_7 = CustomPreview(Geometry=line_sdl_3, Material=create_material_7)

explode_3 = Explode(Curve=interpolate_3.Curve, Recursive=True)  # -> Segments, Vertices
evaluate_length_6 = EvaluateLength(Curve=explode_3.Segments, Length=0.5, Normalized=True)  # -> Point, Tangent, Parameter
curve_closest_point_3 = CurveClosestPoint(Point=evaluate_length_6.Point, Curve=curve_2)  # -> Point, Parameter, Distance
line_4 = Line(StartPoint=curve_closest_point_3.Point, EndPoint=evaluate_length_6.Point)

create_material_8 = CreateMaterial(Diffuse=RGB(199, 199, 199), Specular=RGB(0, 255, 255), Emission=RGB(0, 0, 0), Transparency=0.5, Shine=100)
create_material_9 = CreateMaterial(Diffuse=RGB(224, 224, 224), Specular=RGB(0, 255, 255), Emission=RGB(0, 0, 0), Transparency=0.5, Shine=100)
quick_graph_4 = QuickGraph(list_item_3, SortOrder=0)
line_sdl_4 = LineSDL(Start=evaluate_length_6.Point, Direction=line_4, Length=expr("ABS(X)", multiplication_12))
evaluate_length_7 = EvaluateLength(Curve=line_sdl_4, Length=1, Normalized=True)  # -> Point, Tangent, Parameter
interpolate_4 = Interpolate(Vertices=evaluate_length_7.Point, Degree=1, Periodic=False, KnotStyle=2)  # -> Curve, Length, Domain
custom_preview_8 = CustomPreview(Geometry=interpolate_4.Curve, Material=create_material_8)
custom_preview_9 = CustomPreview(Geometry=line_sdl_4, Material=create_material_9)

explode_4 = Explode(Curve=interpolate_4.Curve, Recursive=True)  # -> Segments, Vertices
evaluate_length_8 = EvaluateLength(Curve=explode_4.Segments, Length=0.5, Normalized=True)  # -> Point, Tangent, Parameter
curve_closest_point_4 = CurveClosestPoint(Point=evaluate_length_8.Point, Curve=curve_2)  # -> Point, Parameter, Distance
line_5 = Line(StartPoint=curve_closest_point_4.Point, EndPoint=evaluate_length_8.Point)

create_material_10 = CreateMaterial(Diffuse=RGB(191, 191, 191), Specular=RGB(0, 255, 255), Emission=RGB(0, 0, 0), Transparency=0.5, Shine=100)
create_material_11 = CreateMaterial(Diffuse=RGB(217, 217, 217), Specular=RGB(0, 255, 255), Emission=RGB(0, 0, 0), Transparency=0.5, Shine=100)
quick_graph_5 = QuickGraph(list_item_4, SortOrder=0)
line_sdl_5 = LineSDL(Start=evaluate_length_8.Point, Direction=line_5, Length=expr("ABS(X)", multiplication_10))
evaluate_length_9 = EvaluateLength(Curve=line_sdl_5, Length=1, Normalized=True)  # -> Point, Tangent, Parameter
interpolate_5 = Interpolate(Vertices=evaluate_length_9.Point, Degree=1, Periodic=False, KnotStyle=2)  # -> Curve, Length, Domain
custom_preview_10 = CustomPreview(Geometry=interpolate_5.Curve, Material=create_material_10)
custom_preview_11 = CustomPreview(Geometry=line_sdl_5, Material=create_material_11)

explode_5 = Explode(Curve=interpolate_5.Curve, Recursive=True)  # -> Segments, Vertices
evaluate_length_10 = EvaluateLength(Curve=explode_5.Segments, Length=0.5, Normalized=True)  # -> Point, Tangent, Parameter
curve_closest_point_5 = CurveClosestPoint(Point=evaluate_length_10.Point, Curve=curve_2)  # -> Point, Parameter, Distance
line_6 = Line(StartPoint=curve_closest_point_5.Point, EndPoint=evaluate_length_10.Point)

create_material_12 = CreateMaterial(Diffuse=RGB(184, 184, 184), Specular=RGB(0, 255, 255), Emission=RGB(0, 0, 0), Transparency=0.5, Shine=100)
create_material_13 = CreateMaterial(Diffuse=RGB(209, 209, 209), Specular=RGB(0, 255, 255), Emission=RGB(0, 0, 0), Transparency=0.5, Shine=100)
quick_graph_6 = QuickGraph(list_item_5, SortOrder=0)
line_sdl_6 = LineSDL(Start=evaluate_length_10.Point, Direction=line_6, Length=expr("ABS(X)", multiplication_8))
evaluate_length_11 = EvaluateLength(Curve=line_sdl_6, Length=1, Normalized=True)  # -> Point, Tangent, Parameter
interpolate_6 = Interpolate(Vertices=evaluate_length_11.Point, Degree=1, Periodic=False, KnotStyle=2)  # -> Curve, Length, Domain
custom_preview_12 = CustomPreview(Geometry=interpolate_6.Curve, Material=create_material_12)
custom_preview_13 = CustomPreview(Geometry=line_sdl_6, Material=create_material_13)

explode_6 = Explode(Curve=interpolate_6.Curve, Recursive=True)  # -> Segments, Vertices
evaluate_length_12 = EvaluateLength(Curve=explode_6.Segments, Length=0.5, Normalized=True)  # -> Point, Tangent, Parameter
curve_closest_point_6 = CurveClosestPoint(Point=evaluate_length_12.Point, Curve=curve_2)  # -> Point, Parameter, Distance
line_7 = Line(StartPoint=curve_closest_point_6.Point, EndPoint=evaluate_length_12.Point)

create_material_14 = CreateMaterial(Diffuse=RGB(176, 176, 176), Specular=RGB(0, 255, 255), Emission=RGB(0, 0, 0), Transparency=0.5, Shine=100)
create_material_15 = CreateMaterial(Diffuse=RGB(201, 201, 201), Specular=RGB(0, 255, 255), Emission=RGB(0, 0, 0), Transparency=0.5, Shine=100)
quick_graph_7 = QuickGraph(list_item_6, SortOrder=0)
line_sdl_7 = LineSDL(Start=evaluate_length_12.Point, Direction=line_7, Length=expr("ABS(X)", multiplication_6))
evaluate_length_13 = EvaluateLength(Curve=line_sdl_7, Length=1, Normalized=True)  # -> Point, Tangent, Parameter
interpolate_7 = Interpolate(Vertices=evaluate_length_13.Point, Degree=1, Periodic=False, KnotStyle=2)  # -> Curve, Length, Domain
custom_preview_14 = CustomPreview(Geometry=interpolate_7.Curve, Material=create_material_14)
custom_preview_15 = CustomPreview(Geometry=line_sdl_7, Material=create_material_15)

explode_7 = Explode(Curve=interpolate_7.Curve, Recursive=True)  # -> Segments, Vertices
evaluate_length_14 = EvaluateLength(Curve=explode_7.Segments, Length=0.5, Normalized=True)  # -> Point, Tangent, Parameter
curve_closest_point_7 = CurveClosestPoint(Point=evaluate_length_14.Point, Curve=curve_2)  # -> Point, Parameter, Distance
line_8 = Line(StartPoint=curve_closest_point_7.Point, EndPoint=evaluate_length_14.Point)

create_material_16 = CreateMaterial(Diffuse=RGB(176, 176, 176), Specular=RGB(0, 255, 255), Emission=RGB(0, 0, 0), Transparency=0.5, Shine=100)
create_material_17 = CreateMaterial(Diffuse=RGB(201, 201, 201), Specular=RGB(0, 255, 255), Emission=RGB(0, 0, 0), Transparency=0.5, Shine=100)
quick_graph_8 = QuickGraph(list_item_7, SortOrder=0)
line_sdl_8 = LineSDL(Start=evaluate_length_14.Point, Direction=line_8, Length=expr("ABS(X)", multiplication_4))
evaluate_length_15 = EvaluateLength(Curve=line_sdl_8, Length=1, Normalized=True)  # -> Point, Tangent, Parameter
interpolate_8 = Interpolate(Vertices=evaluate_length_15.Point, Degree=1, Periodic=False, KnotStyle=2)  # -> Curve, Length, Domain
custom_preview_16 = CustomPreview(Geometry=interpolate_8.Curve, Material=create_material_16)
custom_preview_17 = CustomPreview(Geometry=line_sdl_8, Material=create_material_17)

# ==== cluster DIFERENCECURWATURELINEARGRAPH
y_component = ClusterInput()
y_component_2 = ClusterInput()
y_component_3 = ClusterInput()
y_component_4 = ClusterInput()
y_component_5 = ClusterInput()
y_component_6 = ClusterInput()
y_component_7 = ClusterInput()
y_component_8 = ClusterInput()
y_component_9 = ClusterInput()
B = ClusterInput()
B_2 = ClusterInput()
B_3 = ClusterInput()
B_4 = ClusterInput()
B_5 = ClusterInput()
B_6 = ClusterInput()
B_7 = ClusterInput()
B_8 = ClusterInput()
B_9 = ClusterInput()

line_sdl = LineSDL(Start=Point(-2.121093912, 1.99985794, 0), Direction=Vector(0.0625, 0.0625, 0), Length=1)

line_sdl_2 = LineSDL(Start=Point(0, 0, 0), Direction=Vector(1, 0, 0), Length=1)

create_material = CreateMaterial(Diffuse=RGB(161, 161, 161), Specular=RGB(0, 255, 255), Emission=RGB(0, 0, 0), Transparency=0.5, Shine=100)

create_material_2 = CreateMaterial(Diffuse=RGB(186, 186, 186), Specular=RGB(0, 255, 255), Emission=RGB(0, 0, 0), Transparency=0.5, Shine=100)

create_material_3 = CreateMaterial(Diffuse=RGB(168, 168, 168), Specular=RGB(0, 255, 255), Emission=RGB(0, 0, 0), Transparency=0.5, Shine=100)

create_material_4 = CreateMaterial(Diffuse=RGB(194, 194, 194), Specular=RGB(0, 255, 255), Emission=RGB(0, 0, 0), Transparency=0.5, Shine=100)

create_material_5 = CreateMaterial(Diffuse=RGB(176, 176, 176), Specular=RGB(0, 255, 255), Emission=RGB(0, 0, 0), Transparency=0.5, Shine=100)

create_material_6 = CreateMaterial(Diffuse=RGB(201, 201, 201), Specular=RGB(0, 255, 255), Emission=RGB(0, 0, 0), Transparency=0.5, Shine=100)

create_material_7 = CreateMaterial(Diffuse=RGB(184, 184, 184), Specular=RGB(0, 255, 255), Emission=RGB(0, 0, 0), Transparency=0.5, Shine=100)

create_material_8 = CreateMaterial(Diffuse=RGB(209, 209, 209), Specular=RGB(0, 255, 255), Emission=RGB(0, 0, 0), Transparency=0.5, Shine=100)

create_material_9 = CreateMaterial(Diffuse=RGB(191, 191, 191), Specular=RGB(0, 255, 255), Emission=RGB(0, 0, 0), Transparency=0.5, Shine=100)

create_material_10 = CreateMaterial(Diffuse=RGB(217, 217, 217), Specular=RGB(0, 255, 255), Emission=RGB(0, 0, 0), Transparency=0.5, Shine=100)

create_material_11 = CreateMaterial(Diffuse=RGB(199, 199, 199), Specular=RGB(0, 255, 255), Emission=RGB(0, 0, 0), Transparency=0.5, Shine=100)

create_material_12 = CreateMaterial(Diffuse=RGB(224, 224, 224), Specular=RGB(0, 255, 255), Emission=RGB(0, 0, 0), Transparency=0.5, Shine=100)

create_material_13 = CreateMaterial(Diffuse=RGB(207, 207, 207), Specular=RGB(0, 255, 255), Emission=RGB(0, 0, 0), Transparency=0.5, Shine=100)

create_material_14 = CreateMaterial(Diffuse=RGB(232, 232, 232), Specular=RGB(0, 255, 255), Emission=RGB(0, 0, 0), Transparency=0.5, Shine=100)

create_material_15 = CreateMaterial(Diffuse=RGB(214, 214, 214), Specular=RGB(0, 255, 255), Emission=RGB(0, 0, 0), Transparency=0.5, Shine=100)

create_material_16 = CreateMaterial(Diffuse=RGB(240, 240, 240), Specular=RGB(0, 255, 255), Emission=RGB(0, 0, 0), Transparency=0.5, Shine=100)

create_material_17 = CreateMaterial(Diffuse=RGB(222, 222, 222), Specular=RGB(0, 255, 255), Emission=RGB(0, 0, 0), Transparency=0.5, Shine=100)

create_material_18 = CreateMaterial(Diffuse=RGB(247, 247, 247), Specular=RGB(0, 255, 255), Emission=RGB(0, 0, 0), Transparency=0.5, Shine=100)

count = ClusterInput()
curve = ClusterInput()
curve_2 = Curve(graft(curve))
divide_curve = DivideCurve(Curve=curve_2, Count=count, Kinks=False)  # -> Points, Tangents, Parameters
curvature = Curvature(Curve=curve_2, Parameter=divide_curve.Parameters)  # -> Point, Curvature, Curvature_2
deconstruct_arc = DeconstructArc(Arc=curvature.Curvature_2)  # -> BasePlane, Radius, Angle
expression = Expression(O=deconstruct_arc.Radius, Expression="FORMAT(\"{0:R}\",O)")
panel = Panel(expression)
quick_graph = QuickGraph(deconstruct_arc.Radius, SortOrder=0)
curve_degree = CurveDegree(Curve=curve_2)
one_over_x = OneOverX(Value=deconstruct_arc.Radius)

expression_2 = Expression(O=one_over_x, Expression="FORMAT(\"{0:R}\",O)")
panel_2 = Panel(expression_2)

replace_nulls = ReplaceNulls(Items=one_over_x, Replacements=0)  # -> Items, Count
relative_differences = RelativeDifferences(Values=replace_nulls.Items)

control_points = ControlPoints(Curve=curve_2)  # -> Points, Weights, Knots
list_length = ListLength(List=control_points.Points)  # -> expr("X-1", Length)

expression_3 = Expression(O=relative_differences, Expression="FORMAT(\"{0:R}\",O)")
panel_3 = Panel(expression_3)
quick_graph_2 = QuickGraph(relative_differences, SortOrder=0)
multiplication = Multiplication(A=relative_differences, B=B_8)

quick_graph_3 = QuickGraph(one_over_x, SortOrder=0)
multiplication_2 = Multiplication(A=one_over_x, B=B_9)

replace_nulls_2 = ReplaceNulls(Items=relative_differences, Replacements=0)  # -> Items, Count
relative_differences_2 = RelativeDifferences(Values=replace_nulls_2.Items)
expression_4 = Expression(O=relative_differences_2, Expression="FORMAT(\"{0:R}\",O)")
panel_4 = Panel(expression_4)
quick_graph_4 = QuickGraph(relative_differences_2, SortOrder=0)
multiplication_3 = Multiplication(A=relative_differences_2, B=B_7)

replace_nulls_3 = ReplaceNulls(Items=relative_differences_2, Replacements=0)  # -> Items, Count
relative_differences_3 = RelativeDifferences(Values=replace_nulls_3.Items)
expression_5 = Expression(O=relative_differences_3, Expression="FORMAT(\"{0:R}\",O)")
panel_5 = Panel(expression_5)
quick_graph_5 = QuickGraph(relative_differences_3, SortOrder=0)
multiplication_4 = Multiplication(A=relative_differences_3, B=B_6)

replace_nulls_4 = ReplaceNulls(Items=relative_differences_3, Replacements=0)  # -> Items, Count
relative_differences_4 = RelativeDifferences(Values=replace_nulls_4.Items)
expression_6 = Expression(O=relative_differences_4, Expression="FORMAT(\"{0:R}\",O)")
panel_6 = Panel(expression_6)
quick_graph_6 = QuickGraph(relative_differences_4, SortOrder=0)
multiplication_5 = Multiplication(A=relative_differences_4, B=B_5)

replace_nulls_5 = ReplaceNulls(Items=relative_differences_4, Replacements=0)  # -> Items, Count
relative_differences_5 = RelativeDifferences(Values=replace_nulls_5.Items)
expression_7 = Expression(O=relative_differences_5, Expression="FORMAT(\"{0:R}\",O)")
panel_7 = Panel(expression_7)
quick_graph_7 = QuickGraph(relative_differences_5, SortOrder=0)
multiplication_6 = Multiplication(A=relative_differences_5, B=B_4)

replace_nulls_6 = ReplaceNulls(Items=relative_differences_5, Replacements=0)  # -> Items, Count
relative_differences_6 = RelativeDifferences(Values=replace_nulls_6.Items)

expression_8 = Expression(O=relative_differences_6, Expression="FORMAT(\"{0:R}\",O)")
panel_8 = Panel(expression_8)
quick_graph_8 = QuickGraph(relative_differences_6, SortOrder=0)
multiplication_7 = Multiplication(A=relative_differences_6, B=B_3)

replace_nulls_7 = ReplaceNulls(Items=relative_differences_6, Replacements=0)  # -> Items, Count
relative_differences_7 = RelativeDifferences(Values=replace_nulls_7.Items)
expression_9 = Expression(O=relative_differences_7, Expression="FORMAT(\"{0:R}\",O)")
panel_9 = Panel(expression_9)
quick_graph_9 = QuickGraph(relative_differences_7, SortOrder=0)
multiplication_8 = Multiplication(A=relative_differences_7, B=B_2)

replace_nulls_8 = ReplaceNulls(Items=relative_differences_7, Replacements=0)  # -> Items, Count
relative_differences_8 = RelativeDifferences(Values=replace_nulls_8.Items)
expression_10 = Expression(O=relative_differences_8, Expression="FORMAT(\"{0:R}\",O)")
panel_10 = Panel(expression_10)
quick_graph_10 = QuickGraph(relative_differences_8, SortOrder=0)
multiplication_9 = Multiplication(A=relative_differences_8, B=B)

expression_11 = Expression(A=list_length, B=curve_degree, Expression="A-B+1")
number = Number(expression_11)

divide_curve_2 = DivideCurve(Curve=line_sdl_2, Count=number, Kinks=False)  # -> Points, Tangents, Parameters
line_sdl_3 = LineSDL(Start=divide_curve_2.Points, Direction=Vector(0, 1, 0), Length=multiplication_2)

curve_3 = Curve(line_sdl_3)

list_length_2 = ListLength(List=curve_2)  # -> flatten(Length)
mass_addition = MassAddition(Input=list_length_2)  # -> Result, PartialResults
panel_11 = Panel(mass_addition.Result)
series = Series(Start=1, Step=1, Count=panel_11)  # -> graft(Series)
vector_xyz = VectorXYZ(XComponent=expr("-X", series), YComponent=y_component_9, ZComponent=0)  # -> Vector, Length
move = Move(Geometry=curve_3, Motion=vector_xyz.Vector)  # -> Geometry, Transform
evaluate_length = EvaluateLength(Curve=move.Geometry, Length=1, Normalized=True)  # -> Point, Tangent, Parameter
interpolate = Interpolate(Vertices=evaluate_length.Point, Degree=1, Periodic=False, KnotStyle=2)  # -> Curve, Length, Domain

line_sdl_4 = LineSDL(Start=divide_curve_2.Points, Direction=Vector(0, 1, 0), Length=multiplication_9)
vector_xyz_2 = VectorXYZ(XComponent=expr("-X", series), YComponent=y_component, ZComponent=0)  # -> Vector, Length
move_2 = Move(Geometry=line_sdl_4, Motion=vector_xyz_2.Vector)  # -> Geometry, Transform
evaluate_length_2 = EvaluateLength(Curve=move_2.Geometry, Length=1, Normalized=True)  # -> Point, Tangent, Parameter
interpolate_2 = Interpolate(Vertices=evaluate_length_2.Point, Degree=1, Periodic=False, KnotStyle=2)  # -> Curve, Length, Domain

line_sdl_5 = LineSDL(Start=divide_curve_2.Points, Direction=Vector(0, 1, 0), Length=multiplication_8)
vector_xyz_3 = VectorXYZ(XComponent=expr("-X", series), YComponent=y_component_2, ZComponent=0)  # -> Vector, Length
move_3 = Move(Geometry=line_sdl_5, Motion=vector_xyz_3.Vector)  # -> Geometry, Transform
evaluate_length_3 = EvaluateLength(Curve=move_3.Geometry, Length=1, Normalized=True)  # -> Point, Tangent, Parameter
interpolate_3 = Interpolate(Vertices=evaluate_length_3.Point, Degree=1, Periodic=False, KnotStyle=2)  # -> Curve, Length, Domain

line_sdl_6 = LineSDL(Start=divide_curve_2.Points, Direction=Vector(0, 1, 0), Length=multiplication_7)
vector_xyz_4 = VectorXYZ(XComponent=expr("-X", series), YComponent=y_component_3, ZComponent=0)  # -> Vector, Length
move_4 = Move(Geometry=line_sdl_6, Motion=vector_xyz_4.Vector)  # -> Geometry, Transform
evaluate_length_4 = EvaluateLength(Curve=move_4.Geometry, Length=1, Normalized=True)  # -> Point, Tangent, Parameter
interpolate_4 = Interpolate(Vertices=evaluate_length_4.Point, Degree=1, Periodic=False, KnotStyle=2)  # -> Curve, Length, Domain

line_sdl_7 = LineSDL(Start=divide_curve_2.Points, Direction=Vector(0, 1, 0), Length=multiplication_6)
vector_xyz_5 = VectorXYZ(XComponent=expr("-X", series), YComponent=y_component_4, ZComponent=0)  # -> Vector, Length
move_5 = Move(Geometry=line_sdl_7, Motion=vector_xyz_5.Vector)  # -> Geometry, Transform
evaluate_length_5 = EvaluateLength(Curve=move_5.Geometry, Length=1, Normalized=True)  # -> Point, Tangent, Parameter
interpolate_5 = Interpolate(Vertices=evaluate_length_5.Point, Degree=1, Periodic=False, KnotStyle=2)  # -> Curve, Length, Domain

line_sdl_8 = LineSDL(Start=divide_curve_2.Points, Direction=Vector(0, 1, 0), Length=multiplication_5)
vector_xyz_6 = VectorXYZ(XComponent=expr("-X", series), YComponent=y_component_5, ZComponent=0)  # -> Vector, Length
move_6 = Move(Geometry=line_sdl_8, Motion=vector_xyz_6.Vector)  # -> Geometry, Transform
evaluate_length_6 = EvaluateLength(Curve=move_6.Geometry, Length=1, Normalized=True)  # -> Point, Tangent, Parameter
interpolate_6 = Interpolate(Vertices=evaluate_length_6.Point, Degree=1, Periodic=False, KnotStyle=2)  # -> Curve, Length, Domain

line_sdl_9 = LineSDL(Start=divide_curve_2.Points, Direction=Vector(0, 1, 0), Length=multiplication_4)
vector_xyz_7 = VectorXYZ(XComponent=expr("-X", series), YComponent=y_component_6, ZComponent=0)  # -> Vector, Length
move_7 = Move(Geometry=line_sdl_9, Motion=vector_xyz_7.Vector)  # -> Geometry, Transform
evaluate_length_7 = EvaluateLength(Curve=move_7.Geometry, Length=1, Normalized=True)  # -> Point, Tangent, Parameter
interpolate_7 = Interpolate(Vertices=evaluate_length_7.Point, Degree=1, Periodic=False, KnotStyle=2)  # -> Curve, Length, Domain

line_sdl_10 = LineSDL(Start=divide_curve_2.Points, Direction=Vector(0, 1, 0), Length=multiplication_3)
vector_xyz_8 = VectorXYZ(XComponent=expr("-X", series), YComponent=y_component_7, ZComponent=0)  # -> Vector, Length
move_8 = Move(Geometry=line_sdl_10, Motion=vector_xyz_8.Vector)  # -> Geometry, Transform
evaluate_length_8 = EvaluateLength(Curve=move_8.Geometry, Length=1, Normalized=True)  # -> Point, Tangent, Parameter
interpolate_8 = Interpolate(Vertices=evaluate_length_8.Point, Degree=1, Periodic=False, KnotStyle=2)  # -> Curve, Length, Domain

line_sdl_11 = LineSDL(Start=divide_curve_2.Points, Direction=Vector(0, 1, 0), Length=multiplication)
vector_xyz_9 = VectorXYZ(XComponent=expr("-X", series), YComponent=y_component_8, ZComponent=0)  # -> Vector, Length
move_9 = Move(Geometry=line_sdl_11, Motion=vector_xyz_9.Vector)  # -> Geometry, Transform
evaluate_length_9 = EvaluateLength(Curve=move_9.Geometry, Length=1, Normalized=True)  # -> Point, Tangent, Parameter
interpolate_9 = Interpolate(Vertices=evaluate_length_9.Point, Degree=1, Periodic=False, KnotStyle=2)  # -> Curve, Length, Domain

custom_preview = CustomPreview(Geometry=interpolate_2.Curve, Material=create_material)

custom_preview_2 = CustomPreview(Geometry=move_2.Geometry, Material=create_material_2)

custom_preview_3 = CustomPreview(Geometry=interpolate_3.Curve, Material=create_material_3)

custom_preview_4 = CustomPreview(Geometry=move_3.Geometry, Material=create_material_4)

custom_preview_5 = CustomPreview(Geometry=interpolate_4.Curve, Material=create_material_5)

custom_preview_6 = CustomPreview(Geometry=move_4.Geometry, Material=create_material_6)

custom_preview_7 = CustomPreview(Geometry=interpolate_5.Curve, Material=create_material_7)

custom_preview_8 = CustomPreview(Geometry=move_5.Geometry, Material=create_material_8)

custom_preview_9 = CustomPreview(Geometry=interpolate_6.Curve, Material=create_material_9)

custom_preview_10 = CustomPreview(Geometry=move_6.Geometry, Material=create_material_10)

custom_preview_11 = CustomPreview(Geometry=interpolate_7.Curve, Material=create_material_11)

custom_preview_12 = CustomPreview(Geometry=move_7.Geometry, Material=create_material_12)

custom_preview_13 = CustomPreview(Geometry=interpolate_8.Curve, Material=create_material_13)

custom_preview_14 = CustomPreview(Geometry=move_8.Geometry, Material=create_material_14)

custom_preview_15 = CustomPreview(Geometry=interpolate_9.Curve, Material=create_material_15)

custom_preview_16 = CustomPreview(Geometry=move_9.Geometry, Material=create_material_16)

custom_preview_17 = CustomPreview(Geometry=interpolate.Curve, Material=create_material_17)

custom_preview_18 = CustomPreview(Geometry=move.Geometry, Material=create_material_18)
