# Grasshopper definition XHG.⠀⠀⠀⠀◯⠀ᗱᗴᙁ✤ᴥᑎ✤⠀◯⠀ᗱᗴᴥᑎ✤ᗩᗯᴥᑎᑐᑕ⠀◯⠀⠀⠀⠀ⵙ⠀⠀⠀⠀◯⠀ᑐᑕᑎᴥᗯᗩ✤ᑎᴥᗱᗴ⠀◯⠀✤ᑎᴥ✤ᙁᗱᗴ⠀◯⠀⠀⠀⠀.GHX (Grasshopper 1.0.7)

digit_scroller = DigitScroller(Scroller_Digits=12, Scroller_Prefix="Digit Scroller", Scroller_Radix=1, Scroller_Value=1)
digit_scroller_2 = DigitScroller(Scroller_Digits=12, Scroller_Prefix="Digit Scroller", Scroller_Radix=11, Scroller_Value=402)
digit_scroller_3 = DigitScroller(Scroller_Digits=12, Scroller_Prefix="Digit Scroller", Scroller_Radix=1, Scroller_Value=0.00070038828)
digit_scroller_4 = DigitScroller(Scroller_Digits=12, Scroller_Prefix="Digit Scroller", Scroller_Radix=10, Scroller_Value=2)
digit_scroller_5 = DigitScroller(Scroller_Digits=12, Scroller_Prefix="Digit Scroller", Scroller_Radix=1, Scroller_Value=1)
digit_scroller_6 = DigitScroller(Scroller_Digits=12, Scroller_Prefix="Digit Scroller", Scroller_Radix=10, Scroller_Value=2)
digit_scroller_7 = DigitScroller(Scroller_Digits=12, Scroller_Prefix="Digit Scroller", Scroller_Radix=11, Scroller_Value=1)
digit_scroller_8 = DigitScroller(Scroller_Digits=12, Scroller_Prefix="Digit Scroller", Scroller_Radix=11, Scroller_Value=114)
series = Series(Start=0, Step=digit_scroller_3, Count=digit_scroller_2)
expression = Expression(
    X=series,
    O_EZIS_O_SIZE_O=digit_scroller_5,
    O_REWOP_TOOR_O_ROOT_POWER_O=digit_scroller_4,
    O_REWOP_O_POWER_O=digit_scroller_6,
    Expression="(O_EZIS_O_SIZE_O^O_REWOP_O_POWER_O-abs(X-1)^O_REWOP_O_POWER_O)^(1/O_REWOP_TOOR_O_ROOT_POWER_O)")
dup = DuplicateData(Data=digit_scroller, Number=digit_scroller_2, Order=True)
expression_2 = Expression(X=series, Expression="sin(4*atan(1)*x)")
graph = GraphMapper(
    series,
    x0=0,
    x1=1,
    y0=0,
    y1=1,
    A=1,
    B=0,
    container_name="Linear",
    Graph_x0=0.25,
    Graph_x1=0.75,
    Graph_y0=0.25,
    Graph_y1=0.75)
graph_2 = GraphMapper(series, x0=0, x1=0.02, y0=0, y1=0.0625, container_name="Sine", Equation_px=[0, 0.8801338673], Equation_py=[0, 1])
digit_scroller_9 = DigitScroller(Scroller_Digits=12, Scroller_Prefix="Digit Scroller", Scroller_Radix=11, Scroller_Value=1)
stream_filter = StreamFilter(Gate=digit_scroller_9, Stream0=graph, Stream1=graph_2, Stream2=expression, Stream3=expression_2)
turtle = DotNETVBScriptLEGACY(Forward=dup, Left=stream_filter)  # -> out, Points; inputs Forward: list, Left: list
# ---------- turtle: VB ----------
    Dim i As Integer
    Dim dir As New On3dVector(1, 0, 0)    
    Dim pos As New On3dVector(0, 0, 0) 
    Dim axis As New On3dVector(0, 0, 1)
    Dim pnts As New List(Of On3dVector)

    pnts.Add(pos)
    
    For i = 0 To Forward.Count() - 1
      Dim P As New On3dVector
      dir.Rotate(Left(i), axis)      
      P = dir * Forward(i) + pnts(i)
      pnts.Add(P)
    Next
    
    Points = pnts
# ---------- end turtle ----------
intcrv = Interpolate(Vertices=turtle.Points, Degree=3, Periodic=False)  # -> Curve, Length, Domain
curvature_graph = CurvatureGraph(Curve=intcrv.Curve, Density=digit_scroller_7, Scale=digit_scroller_8)
curvature = Curvature(Curve=intcrv.Curve, Parameter=digit_scroller_2)  # -> Point, Curvature, Curvature_2
darc = DeconstructArc(Arc=curvature.Curvature_2)  # -> BasePlane, Radius, Angle
panel = Panel(darc.Radius)
