# Grasshopper definition XHG.ⵙИNⵙⓄⵙᴥⵙᗝⵙᗱᗴⵙ옷ⵙᗩⵙ✤ⵙᑐᑕⵙⓄⵙ8ⵙᑎⵙᑐᑕⵙ◯ⵙᗝⵙᗱᗴⵙ✤ⵙᗩⵙᑐᑕⵙИNⵙᑎⵙᴥⵙ✤ⵙ◯ⵙᙁⵙᗩⵙИNⵙⓄⵙꖴⵙ✤ⵙИNⵙᗱᗴⵙᙏⵙꖴⵙᗝⵙ◯ⵙ∷ⵙ◯ⵙ◯ⵙ∷ⵙ◯ⵙᗝⵙꖴⵙᙏⵙᗱᗴⵙИNⵙ✤ⵙꖴⵙⓄⵙИNⵙᗩⵙᙁⵙ◯ⵙ✤ⵙᴥⵙᑎⵙИNⵙᑐᑕⵙᗩⵙ✤ⵙᗱᗴⵙᗝⵙ◯ⵙᑐᑕⵙᑎⵙ8ⵙⓄⵙᑐᑕⵙ✤ⵙᗩⵙ옷ⵙᗱᗴⵙᗝⵙᴥⵙⓄⵙИNⵙ.GHX (Grasshopper 1.0.7)
# plug-ins: NGon, Pancake

digit_scroller = DigitScroller(Scroller_Digits=12, Scroller_Prefix=" ", Scroller_Radix=11, Scroller_Value=0)
digit_scroller_2 = DigitScroller(Scroller_Digits=12, Scroller_Prefix=" ", Scroller_Radix=11, Scroller_Value=1)
digit_scroller_3 = DigitScroller(Scroller_Digits=12, Scroller_Prefix=" ", Scroller_Radix=11, Scroller_Value=0)
plane_surface = PlaneSurface(
    Plane=Plane(origin=(0, 0, 0), x=(0, 0, 1), y=(1, 0, 0)),
    XSize=Domain(-32657.39642, 32657.39642),
    YSize=Domain(-32657.39642, 32657.39642))
plane_surface_2 = PlaneSurface(
    Plane=Plane(origin=(0, 0, 0), x=(0, 0, 1), y=(0.7071067812, -0.7071067812, 0)),
    XSize=Domain(-32657.39642, 32657.39642),
    YSize=Domain(-32657.39642, 32657.39642))
plane_surface_3 = PlaneSurface(
    Plane=Plane(origin=(0, 0, 0), x=(0, -1, 0), y=(0.7071067812, 0, -0.7071067812)),
    XSize=Domain(-32657.39642, 32657.39642),
    YSize=Domain(-32657.39642, 32657.39642))
geometry = Geometry(flatten([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]))
brep_join = BrepJoin(Breps=geometry)  # -> Breps, Closed
split_brep = SplitBrep(Brep=brep_join.Breps, Cutter=plane_surface_3)
list_item = ListItem(List=split_brep, Index=digit_scroller_3, Wrap=False)
split_brep_2 = SplitBrep(Brep=list_item, Cutter=plane_surface_2)
list_item_2 = ListItem(List=split_brep_2, Index=digit_scroller_2, Wrap=False)
split_brep_3 = SplitBrep(Brep=list_item_2, Cutter=plane_surface)
list_item_3 = ListItem(List=split_brep_3, Index=digit_scroller, Wrap=False)
geometry_2 = Geometry(list_item_3)
mirror = Mirror(Geometry=geometry_2, Plane=plane_surface_2)  # -> Geometry, Transform
merge = Merge(Data1=geometry_2, Data2=mirror.Geometry)
brep_join_2 = BrepJoin(Breps=merge)  # -> Breps, Closed
mirror_2 = Mirror(Geometry=brep_join_2.Breps, Plane=PlaneYZ(0, 0, 0))  # -> Geometry, Transform
merge_2 = Merge(Data1=brep_join_2.Breps, Data2=mirror_2.Geometry)
brep_join_3 = BrepJoin(Breps=merge_2)  # -> Breps, Closed
mirror_3 = Mirror(Geometry=brep_join_3.Breps, Plane=Plane(origin=(0, 0, 0), x=(0, 0, 1), y=(1, 0, 0)))  # -> Geometry, Transform
merge_3 = Merge(Data1=brep_join_3.Breps, Data2=mirror_3.Geometry)
brep_join_4 = BrepJoin(Breps=merge_3)  # -> Breps, Closed
mirror_4 = Mirror(Geometry=brep_join_4.Breps, Plane=PlaneXY(0, 0, 0))  # -> Geometry, Transform
merge_4 = Merge(Data1=brep_join_4.Breps, Data2=mirror_4.Geometry)
mirror_5 = Mirror(Geometry=merge_4, Plane=plane_surface_3)  # -> Geometry, Transform
mirror_6 = Mirror(Geometry=mirror_5.Geometry, Plane=plane_surface_2)  # -> Geometry, Transform
merge_5 = Merge(Data1=merge_4, Data2=mirror_5.Geometry, Data3=mirror_6.Geometry)
brep_join_5 = BrepJoin(Breps=merge_5)  # -> Breps, Closed
merge_faces = MergeFaces(Brep=brep_join_5.Breps)  # -> Breps, Before, After
from_brep = FromBrep(Brep=merge_faces.Breps, Weld=1)  # -> Mesh, Polylines
geometry_3 = Geometry(from_brep.Mesh)
bounding_box = BoundingBox(Content=geometry_3, Plane=PlaneXY(0, 0, 0), UnionBox=True)  # -> Box, Box_2
deconstruct_box = DeconstructBox(Box=bounding_box.Box)  # -> Plane, X, Y, Z
deconstruct_domain = DeconstructDomain(Domain=deconstruct_box.X)  # -> Start, End
multiplication = Multiplication(A=deconstruct_domain.End, B=2)
one_over_x = OneOverX(Value=multiplication)
scale = Scale(Geometry=geometry_3, Center=Point(0, 0, 0), Factor=one_over_x)  # -> Geometry, Transform
format = Format(Format="{0:R}", Culture=127, Data0=one_over_x)
panel = Panel(format)
panel_2 = Panel("C:\JBO.XHG.ⵙИNⵙⓄⵙᴥⵙᗝⵙᗱᗴⵙ옷ⵙᗩⵙ✤ⵙᑐᑕⵙⓄⵙ8ⵙᑎⵙᑐᑕⵙ◯ⵙᗝⵙᗱᗴⵙ✤ⵙᗩⵙᑐᑕⵙИNⵙᑎⵙᴥⵙ✤ⵙ◯ⵙᙁⵙᗩⵙИNⵙⓄⵙꖴⵙ✤ⵙИNⵙᗱᗴⵙᙏⵙꖴⵙᗝⵙ◯ⵙ∷ⵙ◯ⵙ◯ⵙ∷ⵙ◯ⵙᗝⵙꖴⵙᙏⵙᗱᗴⵙИNⵙ✤ⵙꖴⵙⓄⵙИNⵙᗩⵙᙁⵙ◯ⵙ✤ⵙᴥⵙᑎⵙИNⵙᑐᑕⵙᗩⵙ✤ⵙᗱᗴⵙᗝⵙ◯ⵙᑐᑕⵙᑎⵙ8ⵙⓄⵙᑐᑕⵙ✤ⵙᗩⵙ옷ⵙᗱᗴⵙᗝⵙᴥⵙⓄⵙИNⵙ.GHX.OBJ")
true_only_button = TrueOnlyButton(LastSaveLocalization="neutral,N")
geometry_4 = Geometry(geometry_3)
export_as = ExportAs(
    Geometry=geometry_4,
    FileLocation=panel_2,
    Overwrite=False,
    Export=true_only_button,
    CompMode=False,
    LastSaveLocalization="neutral,N")  # -> OK, ExportCommand
