# Grasshopper definition XHG..⠀⠀⠀⠀ⵙ⠀ᗱᗴ⠀ⵙ⠀ᴥ⠀ⵙ⠀ᗱᗴ⠀ⵙ⠀옷⠀ⵙ⠀ߦ⠀ⵙ⠀ᔓᔕ⠀ⵙ⠀◯⠀ⵙ⠀✤⠀ⵙ⠀ᴥ⠀ⵙ⠀ᗩ⠀ⵙ⠀옷⠀ⵙ⠀ᑐᑕ⠀ⵙ⠀◯⠀ⵙ⠀人⠀ⵙ⠀ᑐᑕ⠀ⵙ⠀ИN⠀ⵙ⠀ᗱᗴ⠀ⵙ⠀ᑎ⠀ⵙ⠀¤⠀ⵙ⠀ᗱᗴ⠀ⵙ⠀ᴥ⠀ⵙ⠀ꗳ⠀ⵙ⠀⠀⠀⠀◯⠀⠀⠀⠀ⵙ⠀⠀⠀⠀◯⠀⠀⠀⠀ⵙ⠀ꗳ⠀ⵙ⠀ᴥ⠀ⵙ⠀ᗱᗴ⠀ⵙ⠀¤⠀ⵙ⠀ᑎ⠀ⵙ⠀ᗱᗴ⠀ⵙ⠀ИN⠀ⵙ⠀ᑐᑕ⠀ⵙ⠀人⠀ⵙ⠀◯⠀ⵙ⠀ᑐᑕ⠀ⵙ⠀옷⠀ⵙ⠀ᗩ⠀ⵙ⠀ᴥ⠀ⵙ⠀✤⠀ⵙ⠀◯⠀ⵙ⠀ᔓᔕ⠀ⵙ⠀ߦ⠀ⵙ⠀옷⠀ⵙ⠀ᗱᗴ⠀ⵙ⠀ᴥ⠀ⵙ⠀ᗱᗴ⠀ⵙ⠀⠀⠀⠀..GHX (Grasshopper 1.0.7)
# plug-ins: Firefly.X, CurvePlus, TT Toolbox, Pancake, Wombat, Kangaroo2 Components, Pufferfish, NGon, Yellow, MeshEdit Components, IntraLattice, HoopSnake

panel = Panel("84.406022589954030768899117092091000289089388918088900852079")
evaluate = Evaluate(Expression="Format(\"{0:0.00000000}\", X)", X=panel)
number = Number(panel)
panel_2 = Panel("14")
panel_3 = Panel(evaluate)
panel_4 = Panel("84.406022589954030768899117092091000289089388918088900852079")
one_over_x = OneOverX(Value=Slider(25, range=1..65))
panel_5 = Panel(number)
series = Series(Start=0, Step=1, Count=379)
expression = Expression(O=series, Expression="((3^(1/3^3))^O)/84.406022589954030768899117092091000289089388918088900852079")
series_2 = Series(Start="0", Step="1", Count=Slider(351, range=1..1025))
power = Power(A=3, B=one_over_x)
power_2 = Power(A=power, B=series_2)
panel_6 = Panel(expression)
division = Division(A=panel_4, B=power_2)
multiplication = Multiplication(A=division, B="299792458")
graft_tree = GraftTree(Tree=multiplication, IncludeEmptyLists=True, IncludeNullItems=True)
graft_tree_2 = GraftTree(Tree=division, IncludeEmptyLists=True, IncludeNullItems=True)
division_2 = Division(A=power_2, B=panel_4)
graft_tree_3 = GraftTree(Tree=division_2, IncludeEmptyLists=True, IncludeNullItems=True)
evaluate_2 = Evaluate(Expression="Format(\"{0:0.0000000000000000}\", X)", X=expression)
panel_7 = Panel(evaluate_2)
power_3 = Power(A="9", B="0")
division_3 = Division(A=panel_4, B=power_3)
one_over_x_2 = OneOverX(Value=power_3)
construct_point = ConstructPoint(XCoordinate=0, YCoordinate=graft_tree_2, ZCoordinate=0)
panel_8 = Panel("""28160.0000000000000000 
26579.5006451166000000 
25087.7079028320000000 
23679.6430535447000000 
22350.6068117123000000 
21096.1636424237000000 
19912.1269582132000000 
18794.5451467141000000 
17739.6883825199000000 
16744.0361792384000000 
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""")
panel_9 = Panel([graft_tree_2, graft_tree_3, graft_tree])
panel_10 = Panel("""-0.0009967000000000 
-3.6736000000000000 
-0.0009967000000000 
-0.0009967000000000 
-0.0009967000000000 
-5.7216000000000000 
-0.0009967000000000 
-7.6629330000000000 
-11.1104000000000000 
-13.5850670000000000 
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""")
text_split = TextSplit(Text=panel_8, Separators=" ")
panel_11 = Panel(text_split)
numbers_to_points = NumbersToPoints(Numbers=panel_9, Mask=4)
digit_scroller = DigitScroller(Scroller_Digits=12, Scroller_Prefix="Digit Scroller", Scroller_Radix=11, Scroller_Value=378)
expression_2 = Expression(O=digit_scroller, Expression="((3^(1/3^3))^O)/84.406022589954030768899117092091000289089388918088900852079")
line = Line(StartPoint=Point(0, 0, 0), EndPoint=construct_point)
spiral_rail = SpiralRail(Curve=line, Angle=0, Turns=1, BaseRadius=construct_point, PeakRadius=construct_point, SamplePoint=256)
text_split_2 = TextSplit(Text=panel_10, Separators=" ")
panel_12 = Panel(text_split_2)
xz_plane = XZPlane(Origin=Point(0, 0, 0))
rotate = Rotate(Geometry=spiral_rail, Angle=1.570796327, Plane=xz_plane)  # -> Geometry, Transform
text_tag = TextTag(Location=construct_point, Text=numbers_to_points, Colour=RGB(212, 212, 212))
tone_generator = ToneGenerator(AudioFrequency=expression_2, Volume=one_over_x_2, Duration=division_3, Repeat=Toggle(True))
panel_13 = Panel(expression_2)
number_2 = Number(panel_12)
division_4 = Division(A=number_2, B=20)
power_4 = Power(A=10, B=division_4)
panel_14 = Panel(power_4)

xy_plane = XYPlane(Origin=Point(0, 0, 0))
yz_plane = YZPlane(Origin=Point(0, 0, 0))
xz_plane_2 = XZPlane(Origin=Point(0, 0, 0))
yz_plane_2 = YZPlane(Origin=Point(0, 0, 0))
number_slider = Slider(0, range=0..90)
rotate_direction = RotateDirection(Geometry=xz_plane_2, Center=Point(0, 0, 0), From=Vector(0, 100000, -100000), To=Vector(0, 0, -84641.0625))  # -> Geometry, Transform
rotate_direction_2 = RotateDirection(Geometry=yz_plane_2, Center=Point(0, 0, 0), From=Vector(75498.375, 0, 0), To=Vector(100000, 0, -100000))  # -> Geometry, Transform
plane_surface = PlaneSurface(Plane=xy_plane, XSize=Domain(-100000, 100000), YSize=Domain(-100000, 100000))
plane_surface_2 = PlaneSurface(
    Plane=[xz_plane_2, rotate_direction.Geometry, yz_plane_2, rotate_direction_2.Geometry],
    XSize=Domain(-100000, 100000),
    YSize=Domain(-100000, 100000))
sphere = Sphere(Base=yz_plane_2, Radius=50000)
reverse = Reverse(Vector=xy_plane)
plane_surface_3 = PlaneSurface(Plane=rotate_direction.Geometry, XSize=Domain(-100000, 100000), YSize=Domain(-100000, 100000))
plane_surface_4 = PlaneSurface(Plane=rotate_direction_2.Geometry, XSize=Domain(-100000, 100000), YSize=Domain(-100000, 100000))
surface_split = SurfaceSplit(Surface=sphere, Curves=plane_surface_2)
rotate_2 = Rotate(Geometry=plane_surface, Angle=1.570796327, Plane=yz_plane)  # -> Geometry, Transform
number_slider_2 = Slider(11, range=2..381)
radians = Radians(Degrees=-45)
construct_domain = ConstructDomain(DomainStart=0, DomainEnd=radians)
rotate_3 = Rotate(Geometry=rotate_2.Geometry, Angle=-1.570796327, Plane=PlaneXY(0, 0, 0))  # -> Geometry, Transform
list_item = ListItem(List=surface_split, Index=Slider(13, range=0..16), Wrap=False)
brep_brep = BrepBrep(BrepA=plane_surface_3, BrepB=plane_surface_4, UseTasks=False)  # -> Curves, Points
brep_edges = BrepEdges(Brep=list_item)  # -> Naked, Interior, NonManifold
number_slider_3 = Slider(27, range=0..512)
end_points = EndPoints(Curve=brep_edges.Naked)  # -> Start, End
data = Data([end_points.Start, end_points.End])
point = Point(Point(0, 0, 0))
list_item_2 = ListItem(List=data, Index=0, Wrap=False)
list_item_3 = ListItem(List=data, Index=2, Wrap=False)
mirror = Mirror(Geometry=list_item_3, Plane=xz_plane_2)  # -> Geometry, Transform
line_2 = Line(StartPoint=list_item_3, EndPoint=mirror.Geometry)
length = Length(Curve=line_2)
curve_middle = CurveMiddle(Curve=line_2)
line_3 = Line(StartPoint=Point(0, 0, 0), EndPoint=curve_middle)
division_5 = Division(A=length, B=2)
length_2 = Length(Curve=line_3)
negative = Negative(Value=length_2)
cone = Cone(Base=curve_middle, Radius=division_5, Length=negative)  # -> Cone, Tip
list_item_4 = ListItem(List=data, Index=3, Wrap=False)
list_item_5 = ListItem(List=data, Index=4, Wrap=False)

length_3 = Length(Curve=brep_edges.Naked)
list_item_6 = ListItem(List=length_3, Index=Slider(1, range=0..1), Wrap=False)
panel_15 = Panel(list_item_6)

scale = Scale(Geometry=cone.Cone, Center=Point(0, 0, 0), Factor=2)  # -> Geometry, Transform
point_2 = Point(flatten([point, list_item_4, list_item_5]))
point_3 = Point(flatten([list_item_2, point, list_item_3]))
_4point_surface = _4PointSurface(CornerA=point, CornerB=list_item_4, CornerC=list_item_5)
_4point_surface_2 = _4PointSurface(CornerA=point, CornerB=list_item_2, CornerC=list_item_3)
negative_2 = Negative(Value=construct_domain)
surface_split_2 = SurfaceSplit(Surface=sphere, Curves=scale.Geometry)
scale_2 = Scale(Geometry=[_4point_surface_2, _4point_surface], Center=Point(0, 0, 0), Factor=2)  # -> Geometry, Transform
range = Range(Domain=construct_domain, Steps=1)
brep_brep_2 = BrepBrep(BrepA=_4point_surface_2, BrepB=_4point_surface)  # -> Curves, Points
brep_plane = BrepPlane(Brep=list_item, Plane=scale_2.Geometry)  # -> graft(Curves), graft(Points)
list_item_7 = ListItem(List=surface_split_2, Index=1, Wrap=False)
rotate_4 = Rotate(Geometry=rotate_3.Geometry, Angle=range, Plane=xy_plane)  # -> Geometry, Transform
surface_split_3 = SurfaceSplit(Surface=list_item_7, Curves=rotate_4.Geometry)
number_slider_4 = Slider(2, range=2..10)
list_item_8 = ListItem(List=surface_split_3, Index=1, Wrap=False)
brep_edges_2 = BrepEdges(Brep=list_item_8)  # -> flatten(Naked), Interior, NonManifold
list_item_9 = ListItem(List=brep_edges_2.Naked, Index=0, Wrap=False)
subtraction = Subtraction(A=Slider(2, range=0..10), B=1)
length_4 = Length(Curve=list_item_9)
number_3 = Number(0)
list_item_10 = ListItem(List=brep_edges_2.Naked, Index=1, Wrap=False)
number_4 = Number(graft(0))
line_4 = Line(StartPoint=Point(0, 0, 0), EndPoint=Point(0, 0, 0))
end_points_2 = EndPoints(Curve=list_item_10)  # -> Start, End
point_4 = Point(end_points_2.End)
line_sdl = LineSDL(Start=point_4, Direction=Vector(0, -19054.8125, 0), Length=50000)
point_5 = Point(end_points_2.Start)
line_5 = Line(StartPoint=Point(0, 0, 0), EndPoint=point_5)
extend_curve = ExtendCurve(Curve=line_5, Type=0, Start=0, End=Slider(20710, range=0..111000))
curve_curve = CurveCurve(CurveA=line_sdl, CurveB=extend_curve)  # -> Points, ParamsA, ParamsB
line_6 = Line(StartPoint=Point(0, 0, 0), EndPoint=curve_curve.Points)
end_points_3 = EndPoints(Curve=extend_curve)  # -> Start, End
point_6 = Point(end_points_3.End)
rotate_direction_3 = RotateDirection(Geometry=line_6, Center=curve_curve.Points, From=Vector(35188.5, 0, 0), To=Vector(-32859.125, 0, 0))  # -> Geometry, Transform
end_points_4 = EndPoints(Curve=rotate_direction_3.Geometry)  # -> Start, End
point_7 = Point(end_points_4.Start)
multiplication_2 = Multiplication()
line_7 = Line(StartPoint=Point(0, 0, 0), EndPoint=Point(0, 0, 0))
brep_edges_3 = BrepEdges(Brep=list_item)  # -> Naked, Interior, NonManifold
join_curves = JoinCurves(Curves=flatten(brep_edges_3.Naked), Preserve=False)  # -> flatten(Curves)
number_slider_5 = Slider(0.403042, range=0..1)
digit_scroller_2 = DigitScroller(Scroller_Digits=12, Scroller_Prefix="Digit Scroller", Scroller_Radix=11, Scroller_Value=150)
digit_scroller_3 = DigitScroller(Scroller_Digits=12, Scroller_Prefix="Digit Scroller", Scroller_Radix=11, Scroller_Value=1)
pi = Pi(Factor=2)
pi_2 = Pi(Factor=2)
number_slider_6 = Slider(102, range=0..145)
addition = Addition(A=Slider(7, range=0..146), B=Slider(1, range=0..2))
number_5 = Number(1)
number_6 = Number([1, 145])
number_slider_7 = Slider(1, range=0..1)
number_slider_8 = Slider(0, range=0..90)
range_2 = Range(Domain=Domain(0, 1), Steps=Slider(8, range=1..10))
range_3 = Range(Domain=Domain(0, 1), Steps=Slider(1, range=1..11))
number_7 = Number(263.7690326)
square_root = SquareRoot(Value=2)
B = B(1.5)
B_2 = B(1.5)

data_2 = Data(0)

range_4 = Range(Domain=Domain(0, 1), Steps=Slider(8, range=1..10))
range_5 = Range(Domain=Domain(0, 1), Steps=Slider(4, range=1..11))

file_path = FilePath("C:\ƧLX...⠀⠀⠀⠀ⵙ✤ᴥᗩ옷ᑐᑕⵙᗝᙁⓄ옷ᔓᔕᗱᗴᴥ옷✤ⵙ人✤ꖴᙁᗩꖴИNᗱᗴᕤᕦИNⓄᑐᑕⵙ人ᑐᑕИNᗱᗴᑎ¤ᗱᗴᴥꗳⵙ⠀⠀⠀⠀◯⠀⠀⠀⠀ⵙ⠀⠀⠀⠀◯⠀⠀⠀⠀ⵙꗳᴥᗱᗴ¤ᑎᗱᗴИNᑐᑕ人ⵙᑐᑕⓄИNᕤᕦᗱᗴИNꖴᗩᙁꖴ✤人ⵙ✤옷ᴥᗱᗴᔓᔕ옷Ⓞᙁᗝⵙᑐᑕ옷ᗩᴥ✤ⵙ⠀⠀⠀⠀...XLS")
worksheet_name = WorksheetName("ⵙⓄᴥߦⵙⵔⵔⵘⵈⵙ옷ᴥⵙ◯ⵙ◯ⵙᴥ옷ⵙⵈⵘⵔⵔⵙߦᴥⓄⵙ")
worksheet_name_2 = WorksheetName("ⵙⓄᴥߦⵙⵔⵔⵘⵈⵙ옷ᴥⵙ◯ⵙ◯ⵙᴥ옷ⵙⵈⵘⵔⵔⵙߦᴥⓄⵙ")
number_slider_9 = Slider(1, range=0..1)
file_path_2 = FilePath("C:\ƧLX...⠀⠀⠀⠀ⵙ✤ᴥᗩ옷ᑐᑕⵙᗝᙁⓄ옷ᔓᔕᗱᗴᴥ옷✤ⵙ人✤ꖴᙁᗩꖴИNᗱᗴᕤᕦИNⓄᑐᑕⵙ人ᑐᑕИNᗱᗴᑎ¤ᗱᗴᴥꗳⵙ⠀⠀⠀⠀◯⠀⠀⠀⠀ⵙ⠀⠀⠀⠀◯⠀⠀⠀⠀ⵙꗳᴥᗱᗴ¤ᑎᗱᗴИNᑐᑕ人ⵙᑐᑕⓄИNᕤᕦᗱᗴИNꖴᗩᙁꖴ✤人ⵙ✤옷ᴥᗱᗴᔓᔕ옷Ⓞᙁᗝⵙᑐᑕ옷ᗩᴥ✤ⵙ⠀⠀⠀⠀...XLS")
read_excel_sheet = ReadExcelSheet(Run=True, FilePath=file_path, Worksheet="1", Listen=True)  # -> UserMessages, Columns, Rows
read_excel_sheet_2 = ReadExcelSheet(Run=True, FilePath=file_path_2, Worksheet="2", Listen=True)  # -> UserMessages, Columns, Rows
panel_16 = Panel("FORMAT(\"{0:0.0000000000000000000}\",O)")
number_slider_10 = Slider(100, range=0..100)
number_slider_11 = Slider(1, range=0..256)
number_slider_12 = Slider(2, range=0..10)
number_slider_13 = Slider(2, range=0..10)
number_8 = Number([2, 4])

data_3 = Data(read_excel_sheet.Columns)
data_4 = Data(read_excel_sheet_2.Columns)

panel_17 = Panel(data_3)
panel_18 = Panel(data_4)
explode_tree = ExplodeTree(Data=panel_17)  # -> Branch0, Branch1, Branch2, Branch3, Branch4, Branch5
explode_tree_2 = ExplodeTree(Data=panel_18)  # -> Branch0, Branch1, Branch2, Branch3, Branch4, Branch5
cull_index = CullIndex(List=explode_tree.Branch4, Indices=[0, 1, 2, 3, 4], Wrap=True)
cull_index_2 = CullIndex(List=explode_tree.Branch2, Indices=[0, 1, 2, 3, 4], Wrap=True)
cull_index_3 = CullIndex(List=explode_tree_2.Branch1, Indices=[0, 1, 2, 3], Wrap=True)
cull_index_4 = CullIndex(List=explode_tree_2.Branch0, Indices=[0, 1, 2, 3], Wrap=True)
panel_19 = Panel(cull_index)
panel_20 = Panel(cull_index_2)
panel_21 = Panel(cull_index_3)
panel_22 = Panel(cull_index_4)
stream_filter = StreamFilter(Gate=number_slider_9, Stream0=panel_19, Stream1=panel_21)
stream_filter_2 = StreamFilter(Gate=number_slider_9, Stream0=panel_20, Stream1=panel_22)
number_9 = Number(stream_filter)
number_10 = Number(stream_filter_2)
evaluate_3 = Evaluate(Expression=panel_16, O=number_9)
panel_23 = Panel(number_10)
evaluate_4 = Evaluate(Expression=panel_16, O=number_10)
number_11 = Number(evaluate_3)
panel_24 = Panel(evaluate_3)
panel_25 = Panel(evaluate_4)
list_length = ListLength(List=panel_24)
stream_gate = StreamGate(Stream=panel_25, Gate=number_slider_9)  # -> Target0, Target1, Target2
logarithm = Logarithm(Value=stream_gate.Target0)
multiplication_3 = Multiplication(A=logarithm, B=20)
panel_26 = Panel(logarithm)
panel_27 = Panel(multiplication_3)
subtraction_2 = Subtraction(A=list_length, B=1)
stream_filter_3 = StreamFilter(Gate=number_slider_9, Stream0=panel_27, Stream1=stream_gate.Target1, Stream2=stream_gate.Target2)
list_item_11 = ListItem(List=panel_24, Index=subtraction_2, Wrap=True)
list_item_12 = ListItem(List=panel_24, Index=0, Wrap=True)
construct_domain_2 = ConstructDomain(DomainStart=list_item_11, DomainEnd=list_item_12)
range_6 = Range(Domain=construct_domain_2, Steps=subtraction_2)
list_item_13 = ListItem(List=range_6, Index=0, Wrap=True)
list_item_14 = ListItem(List=range_6, Index=1, Wrap=True)
subtraction_3 = Subtraction(A=list_item_14, B=list_item_13)
division_6 = Division(A=subtraction_3, B=4)
multiplication_4 = Multiplication(A=division_6, B=2)
panel_28 = Panel(range_6)
construct_point_2 = ConstructPoint(XCoordinate=panel_28, YCoordinate=0, ZCoordinate=0)
multiplication_5 = Multiplication(A=stream_filter_3, B=number_7)
panel_29 = Panel(multiplication_5)
sphere_2 = Sphere(Base=construct_point_2, Radius=division_6)
line_sdl_2 = LineSDL(Start=construct_point_2, Direction=Vector(0, 14645.1875, 0), Length=multiplication_5)
pipe = Pipe(Curve=line_sdl_2, Radius=division_6, Caps=2)
panel_30 = Panel(panel_29)
panel_31 = Panel(line_sdl_2)
ellipse = Ellipse(Plane=construct_point_2, Radius1=division_6, Radius2=panel_30)  # -> Ellipse, Focus1, Focus2
scale_nu = ScaleNU(Geometry=ellipse.Ellipse, Plane=construct_point_2, ScaleX=1, ScaleY=number_8, ScaleZ=1)  # -> Geometry, Transform
bounding_box = BoundingBox(Content=ellipse.Ellipse, Plane=PlaneXY(0, 0, 0))  # -> Box, Box_2
deconstruct_box = DeconstructBox(Box=bounding_box.Box)  # -> Plane, X, Y, Z
deconstruct_domain = DeconstructDomain(Domain=deconstruct_box.X)  # -> Start, End
subtraction_4 = Subtraction(A=deconstruct_domain.End, B=deconstruct_domain.Start)
panel_32 = Panel(subtraction_4)
deconstruct_domain_2 = DeconstructDomain(Domain=deconstruct_box.Y)  # -> Start, End
vector_xyz = VectorXYZ(XComponent=0, YComponent=deconstruct_domain_2.Start, ZComponent=0)  # -> Vector, Length
move = Move(Geometry=ellipse.Ellipse, Motion=vector_xyz.Vector)  # -> Geometry, Transform
rotate_direction_4 = RotateDirection(Geometry=move.Geometry, Center=construct_point_2, From=Vector(2973.3125, 0, 0), To=Vector(0, 0, -1425.375))  # -> Geometry, Transform
divide_curves_on_intersects = DivideCurvesOnIntersects(Curves=[move.Geometry, rotate_direction_4.Geometry], Tolerance=0)
list_length_2 = ListLength(List=divide_curves_on_intersects)
division_7 = Division(A=list_length_2, B=2)
construct_domain_3 = ConstructDomain(DomainStart=0, DomainEnd=division_7)
subtraction_5 = Subtraction(A=division_7, B=1)
range_7 = Range(Domain=subtraction_5, Steps=subtraction_5)
cull_index_5 = CullIndex(List=divide_curves_on_intersects, Indices=range_7, Wrap=True)
cull_nth = CullNth(List=cull_index_5, CullFrequency=2)
list_item_15 = ListItem(List=cull_nth, Index=Slider(65, range=0..378), Wrap=True)
curve = Curve(cull_nth)
end_points_5 = EndPoints(Curve=curve)  # -> Start, End
panel_33 = Panel(cull_nth)
line_8 = Line(StartPoint=end_points_5.Start, EndPoint=end_points_5.End)
revolution = Revolution(Curve=curve, Axis=line_8, Domain=Domain(0, 6.283185307))
bounding_box_2 = BoundingBox(Content=revolution, Plane=PlaneXY(0, 0, 0), UnionBox=True)  # -> Box, Box_2

subtraction_6 = Subtraction(A=list_length, B=1)
range_8 = Range(Domain=construct_domain, Steps=subtraction_6)
negative_3 = Negative(Value=panel_22)
bounds = Bounds(Numbers=panel_22)
rotate_5 = Rotate(Geometry=rotate_2.Geometry, Angle=range_8, Plane=yz_plane)  # -> Geometry, Transform
brep_plane_2 = BrepPlane(Brep=list_item, Plane=rotate_5.Geometry)  # -> graft(Curves), graft(Points)
negative_4 = Negative(Value=bounds)
remap_numbers = RemapNumbers(Value=negative_3, Source=negative_4, Target=Domain(0, 1))  # -> flatten(Mapped), Clipped
end_points_6 = EndPoints(Curve=brep_plane_2.Curves)  # -> Start, End
negative_5 = Negative(Value=panel_25)  # -> flatten(Result)
curve_length_at = CurveLengthAt(Curve=brep_plane_2.Curves, Point=remap_numbers.Mapped, Normalized=False)  # -> Length, Parameter
multiplication_6 = Multiplication(A=negative_5, B=number_slider_3)  # -> graft(Result)
multiplication_7 = Multiplication(A=negative_5, B=number_slider_3)  # -> reverse(graft(Result))
negative_6 = Negative(Value=multiplication_7)
scale_to_length = ScaleToLength(
    Curve=brep_plane_2.Curves,
    Plane=[end_points_6.Start, end_points_6.End],
    Length=[multiplication_6, multiplication_7],
    FactorX=1,
    FactorY=1,
    FactorZ=1)  # -> Scaled, Transform
negative_7 = Negative(Value=multiplication_6)

list_length_3 = ListLength(List=panel_28)
subtraction_7 = Subtraction(A=list_length_3, B=1)
list_item_16 = ListItem(List=construct_point_2, Index=subtraction_7, Wrap=False)  # -> flatten(Item)
list_item_17 = ListItem(List=construct_point_2, Index=data_2, Wrap=False)  # -> flatten(Item)
line_9 = Line(StartPoint=list_item_17, EndPoint=list_item_16)
length_5 = Length(Curve=line_9)
panel_34 = Panel(length_5)

division_8 = Division(A=panel_15, B=panel_34)
mirror_2 = Mirror(Geometry=scale_to_length.Scaled, Plane=_4point_surface)  # -> Geometry, Transform
data_5 = Data(flatten([scale_to_length.Scaled, mirror_2.Geometry]))
multiplication_8 = Multiplication(A=division_6, B=division_8)
offset_on_srf = OffsetOnSrf(Curve=data_5, Distance=1e-10, Surface=list_item)  # -> flatten(Curve); disabled
project = Project(Curve=data_5, Brep=list_item, Direction=brep_brep_2.Curves)
mirror_3 = Mirror(Geometry=offset_on_srf, Plane=yz_plane)  # -> Geometry, Transform
mesh_pipe = MeshPipe(Curve=offset_on_srf, Radius=multiplication_8, Segments=8, Accuracy=1, CapType=3, Faceted=False)  # -> flatten(Mesh)

addition_2 = Addition(A=subtraction_6, B=2)
range_9 = Range(Domain=construct_domain, Steps=addition_2)

polar_array = PolarArray(Geometry=offset_on_srf, Plane=brep_brep.Curves, Count=3, Angle=6.283185307)  # -> flatten(Geometry), Transform
mirror_4 = Mirror(Geometry=[offset_on_srf, mirror_3.Geometry], Plane=xz_plane_2)  # -> Geometry, Transform
join_curves_2 = JoinCurves(Curves=[offset_on_srf, mirror_3.Geometry, mirror_4.Geometry], Preserve=False)  # -> flatten(Curves)
mesh_join = MeshJoin(Meshes=mesh_pipe)
mirror_5 = Mirror(Geometry=join_curves_2, Plane=xy_plane)  # -> Geometry, Transform
rotate_6 = Rotate(Geometry=rotate_3.Geometry, Angle=range_9, Plane=xy_plane)  # -> Geometry, Transform
division_9 = Division(A=length_4, B=panel_34)
addition_3 = Addition(A=subtraction_6, B=1)
rotate_7 = Rotate(Geometry=[join_curves_2, mirror_5.Geometry], Angle=1.570796327, Plane=xz_plane_2)  # -> Geometry, Transform
flatten_tree = FlattenTree(Tree=negative_5, Path="{0}")
relay = Relay([number_3, addition_3])
join_curves_3 = JoinCurves(Curves=flatten(polar_array.Geometry), Preserve=False)  # -> flatten(Curves)
rotate_8 = Rotate(Geometry=[join_curves_2, mirror_5.Geometry], Angle=1.570796327, Plane=yz_plane)  # -> Geometry, Transform
join_curves_4 = JoinCurves(Curves=[join_curves_2, mirror_5.Geometry, rotate_8.Geometry, rotate_7.Geometry], Preserve=False)  # -> flatten(Curves)
brep_brep_3 = BrepBrep(BrepA=list_item_8, BrepB=rotate_6.Geometry)  # -> Curves, Points
multiplication_9 = Multiplication(A=division_6, B=division_9)
curve_2 = Curve(polar_array.Geometry)

insert_items = InsertItems(List=flatten(flatten_tree), Item=flatten(number_3), Indices=flatten(relay), Wrap=False)  # -> flatten(List)
panel_35 = Panel(insert_items)
panel_36 = Panel(flatten_tree)

end_points_7 = EndPoints(Curve=brep_brep_3.Curves)  # -> Start, End
addition_4 = Addition(A=subtraction_6, B=2)
point_8 = Point(end_points_7.End)
line_10 = Line(StartPoint=point_8, EndPoint=point_7)  # -> graft(Line)
flatten_tree_2 = FlattenTree(Tree=brep_brep_3.Curves, Path="{0}")
relay_2 = Relay([number_3, addition_4])
replace_items = ReplaceItems(List=flatten(line_10), Item=flatten(line_4), Indices=flatten(relay_2), Wrap=True)  # -> graft(List)
length_6 = Length(Curve=flatten_tree_2)
length_7 = Length(Curve=line_10)
curve_3 = Curve(brep_brep_3.Curves)
panel_37 = Panel(line_10)
panel_38 = Panel(length_6)
flip_curve = FlipCurve(Curve=replace_items)  # -> Curve, Flag
multiplication_10 = Multiplication(A=reverse(panel_35), B=1)  # -> reverse(graft(Result))
panel_40 = Panel(replace_items)
list_length_4 = ListLength(List=flatten(curve_3))
panel_41 = Panel(curve_3)
end_points_8 = EndPoints(Curve=brep_brep_3.Curves)  # -> Start, End
mirror_6 = Mirror(Geometry=join_curves_3, Plane=yz_plane)  # -> Geometry, Transform
subtraction_8 = Subtraction(A=list_length_4, B=1)

parameter_pipe_mesh = ParameterPipeMesh(
    Curve=offset_on_srf,
    Radius=multiplication_8,
    ParametersU=range_5,
    ParametersV=range_4,
    Weighted=True,
    Lengths=False,
    Angle=0,
    Rotation=0,
    EndType=2,
    Triangulate=False)  # -> flatten(Piped)
mesh_join_2 = MeshJoin(Meshes=parameter_pipe_mesh)
panel_42 = Panel(mesh_join_2)

scale_to_length_2 = ScaleToLength(Curve=flip_curve.Curve, Plane=point_8, Length=multiplication_10, FactorX=1, FactorY=1, FactorZ=1)  # -> Scaled, Transform
mirror_7 = Mirror(Geometry=join_curves_3, Plane=xy_plane)  # -> Geometry, Transform
end_points_9 = EndPoints(Curve=scale_to_length_2.Scaled)  # -> Start, End
point_9 = Point(end_points_8.End)
point_10 = Point(flatten(point_9))
circle_cnr = CircleCNR(Center=point_10, Normal=point_10, Radius=multiplication_9)  # -> flatten(Circle)
flatten_tree_3 = FlattenTree(Tree=circle_cnr, Path="{0}")
flatten_tree_4 = FlattenTree(Tree=circle_cnr, Path="{0}")
tangent_lines = TangentLines(Point=point_7, Circle=flatten(circle_cnr))  # -> flatten(Tangent1), flatten(Tangent2)
insert_items_2 = InsertItems(List=flatten_tree_4, Item=number_4, Indices=number_4, Wrap=False)
mirror_8 = Mirror(Geometry=join_curves_3, Plane=xz_plane_2)  # -> Geometry, Transform
join_curves_5 = JoinCurves(Curves=flatten([join_curves_3, mirror_6.Geometry, mirror_7.Geometry, mirror_8.Geometry]), Preserve=False)  # -> flatten(Curves)
smooth_corners = SmoothCorners(Curve=join_curves_5, Parameter=Slider(2.000001, range=0..100), Continuity=1)  # -> flatten(CompoundCurve)
offset_on_srf_2 = OffsetOnSrf(Curve=tangent_lines.Tangent2, Distance=1e-10, Surface=sphere)  # disabled
offset_on_srf_3 = OffsetOnSrf(Curve=tangent_lines.Tangent1, Distance=1e-10, Surface=sphere)  # disabled
pipe_2 = Pipe(Curve=join_curves_3, Radius=multiplication_8, Caps=2)  # -> flatten(Pipe); disabled
flatten_tree_5 = FlattenTree(Tree=insert_items_2, Path="{0}")
point_11 = Point(end_points_9.End)
offset_on_srf_4 = OffsetOnSrf(Curve=smooth_corners, Distance=1e-10, Surface=list_item)  # -> flatten(Curve); disabled
insert_items_3 = InsertItems(List=flatten_tree_5, Item=number_4, Indices=subtraction_8, Wrap=False)  # -> flatten(List)
panel_43 = Panel(circle_cnr)
polar_array_2 = PolarArray(Geometry=offset_on_srf, Plane=brep_brep.Curves, Count=3, Angle=6.283185307)  # -> flatten(Geometry), Transform

length_8 = Length(Curve=brep_brep_3.Curves)
sort_list = SortList(Keys=flatten(length_8), ValuesValuesA=flatten(brep_brep_3.Curves))  # -> flatten(Keys), flatten(ValuesValuesA)
reverse_list = ReverseList(List=sort_list.Keys)
reverse_list_2 = ReverseList(List=sort_list.ValuesValuesA)
panel_44 = Panel(reverse_list)

split_with_brep = SplitWithBrep(Curve=smooth_corners, Brep=list_item)  # -> Curve, Points
panel_45 = Panel(insert_items_3)

length_9 = Length(Curve=scale_to_length_2.Scaled)
sort_list_2 = SortList(Keys=flatten(length_9), ValuesValuesA=flatten(scale_to_length_2.Scaled))  # -> flatten(Keys), flatten(ValuesValuesA)
reverse_list_3 = ReverseList(List=sort_list_2.Keys)
reverse_list_4 = ReverseList(List=sort_list_2.ValuesValuesA)
panel_46 = Panel(reverse_list_3)

curve_4 = Curve(split_with_brep.Curve)

mirror_9 = Mirror(Geometry=brep_plane_2.Curves, Plane=_4point_surface)  # -> Geometry, Transform
end_points_10 = EndPoints(Curve=mirror_9.Geometry)  # -> Start, End
point_12 = Point(end_points_10.Start)

point_13 = Point(flatten(point_12))
length_10 = Length(Curve=circle_cnr)
flatten_tree_6 = FlattenTree(Tree=point_9, Path="{0}")  # -> flatten(Tree)
polyline = PolyLine(Vertices=flatten_tree_6, Closed=False)
division_10 = Division(A=length_10, B=pi)
explode = Explode(Curve=polyline, Recursive=True)  # -> Segments, Vertices
curve_middle_2 = CurveMiddle(Curve=explode.Segments)  # -> flatten(Midpoint)
list_item_18 = ListItem(List=panel_46, Index=0, Wrap=True)
length_11 = Length(Curve=explode.Segments)
list_item_19 = ListItem(List=length_7, Index=0, Wrap=True)
line_11 = Line(StartPoint=flatten_tree_6, EndPoint=curve_middle_2)
division_11 = Division(A=list_item_19, B=list_item_18)
scale_3 = Scale(Geometry=scale_to_length_2.Scaled, Center=point_11, Factor=division_11)  # -> Geometry, Transform

end_points_11 = EndPoints(Curve=scale_3.Geometry)  # -> Start, End
point_14 = Point(end_points_11.Start)

offset_on_srf_5 = OffsetOnSrf(Curve=scale_3.Geometry, Distance=1e-10, Surface=list_item_8)
insert_items_4 = InsertItems(List=flatten(offset_on_srf_5), Item=flatten(line_4), Indices=flatten(relay), Wrap=False)
hoopsnake = HoopSnake(
    StartingData=insert_items_4,
    Hoopsnake_Data_autoUpdate=False,
    Hoopsnake_Data_dataLimit=2147483647,
    Hoopsnake_Data_delay=0,
    Hoopsnake_Data_resetCounter=True,
    Hoopsnake_Data_updateView=True)  # -> Feedback, CumulativeFeedback, LoopsCounter, IterationsCounter
panel_47 = Panel(scale_3.Geometry)

curve_5 = Curve(hoopsnake.Feedback)

end_points_12 = EndPoints(Curve=curve_5)  # -> Start, End
point_15 = Point(flatten(end_points_12.Start))
insert_items_5 = InsertItems(List=curve_5, Item=line_7, Indices=number_4, Wrap=False)  # disabled
line_sdl_3 = LineSDL(Start=point_15, Direction=Vector(0, 0, 1), Length=100000)
surface_curve = SurfaceCurve(Surface=sphere, Curve=line_sdl_3)  # -> Curves, flatten(Points), UVPoints, Normals, Parameters, Tangents
pull_point = PullPoint(Point=point_15, Geometry=sphere, ClosestOnly=False)  # -> flatten(ClosestPoint), flatten(Distance); disabled
circle_tantan = CircleTanTan(CurveA=flatten(tangent_lines.Tangent1), CurveB=flatten(tangent_lines.Tangent2), Point=flatten(point_14))
flatten_tree_7 = FlattenTree(Tree=insert_items_5, Path="{0}")
curve_6 = Curve(scale_3.Geometry)
length_12 = Length(Curve=curve_5)  # -> flatten(Length)
insert_items_6 = InsertItems(List=flatten_tree_7, Item=line_7, Indices=subtraction_8, Wrap=False)  # -> flatten(List)
panel_48 = Panel(circle_tantan)
point_on_curve = PointOnCurve(curve_5, parameter=0)
point_on_curve_2 = PointOnCurve(curve_5, parameter=1)
panel_49 = Panel(length_12)
list_length_5 = ListLength(List=insert_items_6)
flatten_tree_8 = FlattenTree(Tree=point_on_curve_2, Path="{0}")
flatten_tree_9 = FlattenTree(Tree=point_on_curve, Path="{0}")
curve_7 = Curve(curve_5)
subtraction_9 = Subtraction(A=list_length_5, B=1)
curve_8 = Curve(curve_5)
insert_items_7 = InsertItems(List=point_on_curve_2, Item=number_4, Indices=number_4, Wrap=False)
insert_items_8 = InsertItems(List=point_on_curve, Item=number_4, Indices=number_4, Wrap=False)
range_10 = Range(Domain=subtraction_9, Steps=subtraction_9)
list_item_20 = ListItem(List=panel_45, Index=range_10, Wrap=True)
panel_50 = Panel(list_item_20)
flatten_tree_10 = FlattenTree(Tree=list_item_20, Path="{0}")
point_on_curve_3 = PointOnCurve(flatten_tree_10, parameter=0)
flatten_tree_11 = FlattenTree(Tree=insert_items_7, Path="{0}")
flatten_tree_12 = FlattenTree(Tree=insert_items_8, Path="{0}")
curve_length_at_2 = CurveLengthAt(Curve=circle_cnr, Point=point_on_curve_3, Normalized=False)  # -> Length, Parameter
length_13 = Length(Curve=circle_tantan)
insert_items_9 = InsertItems(List=flatten_tree_11, Item=number_4, Indices=subtraction_8, Wrap=False)  # -> flatten(List)
panel_51 = Panel(point_on_curve)
insert_items_10 = InsertItems(List=flatten_tree_12, Item=number_4, Indices=subtraction_8, Wrap=False)  # -> flatten(List)
curvature = Curvature(Curve=circle_cnr, Parameter=curve_length_at_2.Parameter)  # -> Point, flatten(Curvature), flatten(Curvature_2)
division_12 = Division(A=length_13, B=pi_2)
panel_52 = Panel(insert_items_9)
panel_53 = Panel(insert_items_10)
length_14 = Length(Curve=line_11)
panel_54 = Panel(length_14)
panel_55 = Panel(division_10)
panel_56 = Panel(length_11)
panel_57 = Panel(division_12)
flatten_tree_13 = FlattenTree(Tree=relay, Path="{0}")
list_item_21 = ListItem(List=flatten_tree_13, Index=1, Wrap=True)
heterogen_custom = HeterogenCustom(Struts=flatten(insert_items_6), StartRadii=flatten(division_10), EndRadii=flatten(division_12))  # disabled
pipe_3 = Pipe(Curve=curve_8, Radius=division_10, Caps=2)  # disabled
curve_9 = Curve(flatten(curve_8))
list_item_22 = ListItem(List=reverse(flatten(curve_9)), Index=flatten(number_slider_6), Wrap=False)  # -> graft(Item)
list_length_6 = ListLength(List=curve_9)
subtraction_10 = Subtraction(A=list_length_6, B=1)
addition_5 = Addition(A=number_5, B=list_item_21)
panel_58 = Panel(curve_9)
construct_domain_4 = ConstructDomain(DomainStart=number_5, DomainEnd=list_item_21)
division_13 = Division(A=addition_5, B=2)
subtraction_11 = Subtraction(A=list_item_21, B=1)
range_11 = Range(Domain=flatten(construct_domain_4), Steps=flatten(subtraction_11))
list_item_23 = ListItem(List=reverse(flatten(division_10)), Index=flatten(range_11), Wrap=False)  # -> graft(Item)
list_item_24 = ListItem(List=reverse(flatten(division_12)), Index=flatten(range_11), Wrap=False)  # -> graft(Item)
panel_59 = Panel(list_item_24)
relay_3 = Relay([number_5, division_13, number_slider_6, list_item_21])
list_item_25 = ListItem(List=reverse(flatten(curve_9)), Index=flatten(range_11), Wrap=False)  # -> graft(Item)
panel_60 = Panel(list_item_25)
addition_6 = Addition(A=range_11, B=0)
panel_61 = Panel(range_11)
relay_4 = Relay([list_item_23, list_item_24])
panel_62 = Panel(list_item_23)
evaluate_length = EvaluateLength(Curve=graft(list_item_25), Length=[0, 1], Normalized=True)  # -> Point, Tangent, reverse(Parameter)
pipe_variable = PipeVariable(Curve=list_item_25, Parameters=evaluate_length.Parameter, Radii=relay_4, Caps=2)
panel_64 = Panel(relay_4)
deconstruct_brep = DeconstructBrep(Brep=pipe_variable)  # -> Faces, Edges, Vertices
panel_65 = Panel(deconstruct_brep.Faces)
panel_66 = Panel(deconstruct_brep.Edges)
panel_67 = Panel(deconstruct_brep.Vertices)
panel_69 = Panel(pipe_variable)
graft_tree_4 = GraftTree(Tree=pipe_variable, IncludeEmptyLists=True, IncludeNullItems=True)
panel_70 = Panel(evaluate_length.Parameter)
negative_8 = Negative(Value=evaluate_length.Parameter)
panel_72 = Panel(division_6)
mesh_pipe_2 = MeshPipe(Curve=line_sdl_2, Radius=division_6, Segments=Slider(8, range=0..10), Accuracy=1, CapType=3, Faceted=False)
mesh_explode = MeshExplode(Mesh=mesh_pipe_2, Interpolate=False)
list_item_26 = ListItem(List=line_sdl_2, Index=Slider(138, range=0..378), Wrap=True)
parameter_pipe_mesh_2 = ParameterPipeMesh(
    Curve=line_sdl_2,
    Radius=division_6,
    ParametersU=range_3,
    ParametersV=range_2,
    Weighted=False,
    Lengths=False,
    Angle=0,
    Rotation=0,
    EndType=2,
    Triangulate=False)
panel_73 = Panel(mesh_pipe_2)
bounding_box_3 = BoundingBox(Content=line_sdl_2, Plane=PlaneXY(0, 0, 0), UnionBox=True)  # -> Box, Box_2
cad_exporter = CADExporter(Export=False, ExportType="DXF", FilePaths="C:\", FileNames="FXD.DXF", Curves=line_sdl_2)
panel_74 = Panel(parameter_pipe_mesh_2)
mesh_explode_2 = MeshExplode(Mesh=parameter_pipe_mesh_2, Interpolate=False)
deconstruct_box_2 = DeconstructBox(Box=bounding_box_3.Box)  # -> Plane, X, Y, Z
deconstruct_domain_3 = DeconstructDomain(Domain=deconstruct_box_2.X)  # -> Start, End
deconstruct_domain_4 = DeconstructDomain(Domain=deconstruct_box_2.Y)  # -> Start, End
stream_filter_4 = StreamFilter(Gate=Slider(0, range=0..1), Stream0=mesh_pipe_2, Stream1=parameter_pipe_mesh_2)
absolute = Absolute(Value=deconstruct_domain_3.End)
absolute_2 = Absolute(Value=deconstruct_domain_3.Start)
absolute_3 = Absolute(Value=deconstruct_domain_4.Start)
absolute_4 = Absolute(Value=deconstruct_domain_4.End)
addition_7 = Addition(A=absolute_2, B=absolute)
addition_8 = Addition(A=absolute_3, B=absolute_4)
division_14 = Division(A=addition_8, B=addition_7)
division_15 = Division(A=addition_7, B=addition_8)
panel_75 = Panel(division_15)
panel_76 = Panel(division_14)
brep = Brep(revolution)
group = Group(Objects=brep)
group_2 = Group(Objects=line_sdl_2)

graft_tree_5 = GraftTree(Tree=curve_5, IncludeEmptyLists=True, IncludeNullItems=True)
mirror_10 = Mirror(Geometry=graft_tree_5, Plane=plane_surface_3)  # -> Geometry, Transform

graft_tree_6 = GraftTree(Tree=mirror_10.Geometry, IncludeEmptyLists=True, IncludeNullItems=True)
flip_curve_2 = FlipCurve(Curve=graft_tree_6)  # -> Curve, Flag
end_points_13 = EndPoints(Curve=mirror_10.Geometry)  # -> Start, End
vector_2pt = Vector2Pt(PointA=end_points_13.Start, PointB=end_points_13.End, Unitize=False)  # -> Vector, Length
point_16 = Point(end_points_13.End)
end_points_14 = EndPoints(Curve=graft_tree_5)  # -> Start, End
point_17 = Point(end_points_14.End)
vector_2pt_2 = Vector2Pt(PointA=end_points_14.Start, PointB=end_points_14.End, Unitize=False)  # -> Vector, Length
biarc = BiArc(StartPoint=point_17, StartTangent=vector_2pt_2.Vector, EndPoint=point_16, EndTangent=vector_2pt.Vector, Ratio=0.5)  # -> FirstArc, SecondArc, BiArc
offset_on_srf_6 = OffsetOnSrf(Curve=biarc.BiArc, Distance=1e-10, Surface=sphere)
insert_items_11 = InsertItems(List=flatten(offset_on_srf_6), Item=flatten(line_4), Indices=flatten(relay), Wrap=False)
blend_curve = BlendCurve(CurveA=graft_tree_5, CurveB=flip_curve_2.Curve, BulgeA=number_slider_5, BulgeB=number_slider_5, Continuity=1)
hoopsnake_2 = HoopSnake(
    StartingData=insert_items_11,
    Hoopsnake_Data_autoUpdate=False,
    Hoopsnake_Data_dataLimit=2147483647,
    Hoopsnake_Data_delay=0,
    Hoopsnake_Data_resetCounter=True,
    Hoopsnake_Data_updateView=True)  # -> Feedback, CumulativeFeedback, LoopsCounter, IterationsCounter
curve_10 = Curve(blend_curve)

curve_11 = Curve(hoopsnake_2.Feedback)

list_item_27 = ListItem(List=flatten(curve_11), Index=Slider(144, range=0..146), Wrap=True)
curvature_graph = CurvatureGraph(Curve=list_item_27, Density=digit_scroller_3, Scale=digit_scroller_2)
polar_array_3 = PolarArray(Geometry=[graft_tree_5, mirror_10.Geometry, curve_11], Plane=brep_brep.Curves, Count=3, Angle=6.283185307)  # -> flatten(Geometry), Transform
blend_curve_pt = BlendCurvePt(CurveA=curve_5, CurveB=flip_curve_2.Curve, Point=point_12, Continuity=1)  # disabled
panel_78 = Panel(offset_on_srf_6)
panel_79 = Panel(curve_11)
join_curves_6 = JoinCurves(Curves=polar_array_3.Geometry, Preserve=False)  # -> flatten(Curves)
multipipe = MultiPipe(Curves=join_curves_6, NodeSize=multiplication_8, EndOffset=1, StrutSize=1, Segment=0, KinkAngle=0.6, CubeFit=0, Caps=0)  # -> flatten(Pipe); disabled
curve_12 = Curve(flatten(curve_11))
list_item_28 = ListItem(List=reverse(flatten(curve_12)), Index=flatten(range_11), Wrap=False)  # -> graft(Item)
pipe_4 = Pipe(Curve=list_item_28, Radius=list_item_23, Caps=0)
graft_tree_7 = GraftTree(Tree=pipe_4, IncludeEmptyLists=True, IncludeNullItems=True)
split_brep = SplitBrep(Brep=graft_tree_4, Cutter=graft_tree_7)
list_item_29 = ListItem(List=split_brep, Index=0, Wrap=True)
mirror_11 = Mirror(Geometry=list_item_29, Plane=plane_surface_3)  # -> Geometry, Transform
brep_join = BrepJoin(Breps=flatten([list_item_29, graft_tree_7, mirror_11.Geometry]))  # -> flatten(Breps), Closed
polar_array_4 = PolarArray(Geometry=flatten(brep_join.Breps), Plane=brep_brep.Curves, Count=3, Angle=6.283185307)  # -> flatten(Geometry), Transform
list_item_30 = ListItem(List=reverse(brep_join.Breps), Index=Slider(4, range=0..5), Wrap=False)
brep_join_2 = BrepJoin(Breps=flatten(polar_array_4.Geometry))  # -> flatten(Breps), Closed
bounding_box_4 = BoundingBox(Content=brep_join_2.Breps, Plane=PlaneXY(0, 0, 0), UnionBox=True)  # -> Box, Box_2
deconstruct_box_3 = DeconstructBox(Box=bounding_box_4.Box)  # -> Plane, X, Y, Z
export_3dm = Export3DM(
    Geometry=brep_join.Breps,
    FileLocation="C:\MDԐ.XHG..⠀⠀⠀⠀ⵙ⠀ᗱᗴ⠀ⵙ⠀ᴥ⠀ⵙ⠀ᗱᗴ⠀ⵙ⠀옷⠀ⵙ⠀ߦ⠀ⵙ⠀ᔓᔕ⠀ⵙ⠀◯⠀ⵙ⠀✤⠀ⵙ⠀ᴥ⠀ⵙ⠀ᗩ⠀ⵙ⠀옷⠀ⵙ⠀ᑐᑕ⠀ⵙ⠀◯⠀ⵙ⠀⁂⠀ⵙ⠀△⠀ⵙ⠀ⵈ⠀ⵙ⠀⠀⠀⠀◯⠀⠀⠀⠀ⵙ⠀⠀⠀⠀◯⠀⠀⠀⠀ⵙ⠀ⵈ⠀ⵙ⠀△⠀ⵙ⠀⁂⠀ⵙ⠀◯⠀ⵙ⠀ᑐᑕ⠀ⵙ⠀옷⠀ⵙ⠀ᗩ⠀ⵙ⠀ᴥ⠀ⵙ⠀✤⠀ⵙ⠀◯⠀ⵙ⠀ᔓᔕ⠀ⵙ⠀ߦ⠀ⵙ⠀옷⠀ⵙ⠀ᗱᗴ⠀ⵙ⠀ᴥ⠀ⵙ⠀ᗱᗴ⠀ⵙ⠀⠀⠀⠀..GHX.3DM",
    Overwrite=Toggle(False),
    Version=0,
    Export=Toggle(False),
    LastSaveLocalization="neutral,N")  # -> OK, Log
panel_80 = Panel(brep_join.Breps)
panel_81 = Panel(polar_array_4.Geometry)
export_3dm_2 = Export3DM(
    Geometry=brep_join_2.Breps,
    FileLocation="C:\MDԐ.Ԑ.XHG..⠀⠀⠀⠀ⵙ⠀ᗱᗴ⠀ⵙ⠀ᴥ⠀ⵙ⠀ᗱᗴ⠀ⵙ⠀옷⠀ⵙ⠀ߦ⠀ⵙ⠀ᔓᔕ⠀ⵙ⠀◯⠀ⵙ⠀✤⠀ⵙ⠀ᴥ⠀ⵙ⠀ᗩ⠀ⵙ⠀옷⠀ⵙ⠀ᑐᑕ⠀ⵙ⠀◯⠀ⵙ⠀⁂⠀ⵙ⠀△⠀ⵙ⠀ⵈ⠀ⵙ⠀⠀⠀⠀◯⠀⠀⠀⠀ⵙ⠀⠀⠀⠀◯⠀⠀⠀⠀ⵙ⠀ⵈ⠀ⵙ⠀△⠀ⵙ⠀⁂⠀ⵙ⠀◯⠀ⵙ⠀ᑐᑕ⠀ⵙ⠀옷⠀ⵙ⠀ᗩ⠀ⵙ⠀ᴥ⠀ⵙ⠀✤⠀ⵙ⠀◯⠀ⵙ⠀ᔓᔕ⠀ⵙ⠀ߦ⠀ⵙ⠀옷⠀ⵙ⠀ᗱᗴ⠀ⵙ⠀ᴥ⠀ⵙ⠀ᗱᗴ⠀ⵙ⠀⠀⠀⠀..GHX.3.3DM",
    Overwrite=Toggle(False),
    Version=0,
    Export=Toggle(False),
    LastSaveLocalization="neutral,N")  # -> OK, Log

number_slider_14 = Slider(10, range=0..10)
construct_point_3 = ConstructPoint(XCoordinate=0, YCoordinate=0, ZCoordinate=0)
division_16 = Division(A=number_slider_14, B="3")
import_obj = ImportOBJ(File="C:\JBO.PIH.FXD.FXD.DXF.DXF.HIP.OBJ", MapYtoZ=False, LastSaveLocalization="neutral,N")
ⵙ人ⵙᴥⵙ_ⵙᗱᗴⵙᙏⵙ_ⵙᗱᗴⵙᕤᕦⵙ_ⵙ_ⵙᕤᕦⵙᗱᗴⵙ_ⵙᙏⵙᗱᗴⵙ_ⵙᴥ = Slider(1, range=0..1)  # "ⵙ人ⵙᴥⵙ✤ⵙᗱᗴⵙᙏⵙⓄⵙᗱᗴⵙᕤᕦⵙ◯ⵙ◯ⵙᕤᕦⵙᗱᗴⵙⓄⵙᙏⵙᗱᗴⵙ✤ⵙᴥⵙ人ⵙ"
ⵙꕤⵙ_ⵙᴥⵙ_ⵙᴥⵙꖴⵙᙏⵙ_ⵙ_ⵙᙏⵙꖴⵙᴥⵙ_ⵙᴥⵙ_ⵙꕤⵙ = Slider(1, range=0..1)
ⵙꕤⵙ_ⵙ8ⵙ_ⵙᕤᕦⵙиnⵙꖴⵙᗝⵙиnⵙᑎⵙ_ⵙ8ⵙ_ⵙ_ⵙ8ⵙ_ⵙᑎⵙиn = Slider(0, range=0..1)  # "ⵙꕤⵙⓄⵙ8ⵙ◯ⵙᕤᕦⵙИNⵙꖴⵙᗝⵙИNⵙᑎⵙⓄⵙ8ⵙ◯ⵙ◯ⵙ8ⵙⓄⵙᑎⵙИNⵙᗝⵙꖴⵙИNⵙᕤᕦⵙ◯ⵙ8ⵙⓄⵙꕤ"
cone_2 = Cone(Base=PlaneYZ(0, 0, 0), Radius=20, Length=80)  # -> Cone, Tip
weldmesh = WeldMesh(Mesh=import_obj, Radius=1e-10, Align=False, Use_RTree=False)
division_17 = Division(A=number_slider_14, B="9")
multiplication_11 = Multiplication(A=number_slider_14, B="sqrt(3)")
spiral = Spiral(
    BasePlane=Plane(origin=(0, 0, 0), x=(0, 1, 0), y=(-1, 0, 0)),
    Angle=31.41592654,
    Turns=division_17,
    BaseRadius=multiplication_11,
    PeakRadius=division_16)
pipe_5 = Pipe(Curve=spiral, Radius=number_slider_14, Caps=2)
multipipe_2 = MultiPipe(
    Curves=spiral,
    NodeSize=division_17,
    EndOffset=division_16,
    StrutSize=division_17,
    Segment=0,
    KinkAngle=0.6,
    CubeFit=0,
    Caps=1)
stream_filter_5 = StreamFilter(Gate=Slider(1, range=0..2), Stream0=import_obj, Stream1=group_2, Stream2=multipipe_2)
geometry = Geometry(stream_filter_5)
bounding_box_5 = BoundingBox(Content=geometry, Plane=PlaneXY(0, 0, 0), UnionBox=True)  # -> Box, Box_2
center_geometry_at_origin = CenterGeometryAtOrigin(Geometry=bounding_box_5.Box)  # -> RecenteredGeometry, TranslationVector
stream_filter_6 = StreamFilter(Gate=ⵙꕤⵙ_ⵙ8ⵙ_ⵙᕤᕦⵙиnⵙꖴⵙᗝⵙиnⵙᑎⵙ_ⵙ8ⵙ_ⵙ_ⵙ8ⵙ_ⵙᑎⵙиn, Stream1=bounding_box_5.Box)
stream_filter_7 = StreamFilter(Gate=ⵙ人ⵙᴥⵙ_ⵙᗱᗴⵙᙏⵙ_ⵙᗱᗴⵙᕤᕦⵙ_ⵙ_ⵙᕤᕦⵙᗱᗴⵙ_ⵙᙏⵙᗱᗴⵙ_ⵙᴥ, Stream1=geometry)
move_2 = Move(Geometry=[stream_filter_7, stream_filter_6], Motion=center_geometry_at_origin.TranslationVector)  # -> Geometry, Transform
export_file_to_path = ExportFileToPath(Run=Toggle(False), GeometryToExport=move_2.Geometry, ExportPath="C:\T888......OBJ")
bounding_box_6 = BoundingBox(Content=move_2.Geometry, Plane=PlaneXY(0, 0, 0), UnionBox=True)  # -> Box, Box_2
geometry_2 = Geometry(move_2.Geometry)
deconstruct_box_4 = DeconstructBox(Box=bounding_box_6.Box)  # -> Plane, X, Y, Z
deconstruct_domain_5 = DeconstructDomain(Domain=deconstruct_box_4.Y)  # -> Start, End
deconstruct_domain_6 = DeconstructDomain(Domain=deconstruct_box_4.Z)  # -> Start, End
deconstruct_domain_7 = DeconstructDomain(Domain=deconstruct_box_4.X)  # -> Start, End
line_12 = Line(Line((-299.7957001, 0, 0), (-299.7957001, -99.65670013, 0)))
line_13 = Line(Line((-99.65670013, 0, 0), (-99.65670013, -0.001, 0)))
geometry_3 = Geometry(<mesh referenced from the Rhino model>)
reduce_mesh = ReduceMesh(Mesh=geometry_3, FaceCount=0, Accuracy=10, FaceType=1, Distort=False, Normalize=False)  # -> Reduced, CountDifference
move_3 = Move(Geometry=reduce_mesh.Reduced, Motion=Vector(-457.5, 0, 238.875))  # -> Geometry, Transform
taper = Taper(
    Geometry=reduce_mesh.Reduced,
    Axis=Line((-299.7957001, 0, 0), (-99.65670013, 0, 0)),
    Start=line_12,
    End=line_13,
    Flat=False,
    Infinite=False,
    Rigid=False)
move_4 = Move(Geometry=taper, Motion=Vector(-199.3134003, 0, 0))  # -> Geometry, Transform
scale_nu_2 = ScaleNU(Geometry=taper, Plane=PlaneXY(-1670.120177, 0, 0), ScaleX=0.7071067812, ScaleY=1, ScaleZ=1)  # -> Geometry, Transform

mesh_join_3 = MeshJoin(Meshes=import_obj)
yz_plane_3 = YZPlane(Origin=Point(0, 0, 0))
mirror_cut_mesh = MirrorCutMesh(
    Mesh=mesh_join_3,
    MirrorPlane=yz_plane_3,
    Reach=0,
    Offset=0,
    Flip=False,
    Join=False,
    Keep=False,
    ConnectionType=2,
    Bulge=0,
    Divisions=0,
    WeldVertices=0)  # -> MirrorCut, SplitIndex, ReachPlane, OffsetPlane, Intersected
mirror_12 = Mirror(Geometry=mirror_cut_mesh.MirrorCut, Plane=PlaneYZ(0, 0, 0))  # -> Geometry, Transform
mesh_join_4 = MeshJoin(Meshes=[mirror_12.Geometry, mirror_cut_mesh.MirrorCut])

division_18 = Division(A=division_6, B=deconstruct_domain_7.End)
addition_9 = Addition(A=division_18, B=1)
division_19 = Division(A=division_18, B=1)
addition_10 = Addition(A=division_19, B=1)
multiplication_12 = Multiplication(A=division_19, B=1.5)
addition_11 = Addition(A=multiplication_12, B=1)
multiplication_13 = Multiplication(A=addition_11, B=Slider(4, range=0..12))
multiplication_14 = Multiplication(A=addition_9, B=Slider(4, range=0..6))
multiplication_15 = Multiplication(A=addition_10, B=B)
multiplication_16 = Multiplication(A=addition_10, B=B_2)

multiplication_17 = Multiplication(A=deconstruct_domain_7.Start, B=multiplication_15)
multiplication_18 = Multiplication(A=deconstruct_domain_5.Start, B=multiplication_16)
addition_12 = Addition(A=multiplication_17, B=multiplication_18)

multiplication_19 = Multiplication(A=deconstruct_domain_5.Start, B="3")
addition_13 = Addition(A=deconstruct_domain_7.Start, B=multiplication_19)
addition_14 = Addition(A=addition_13, B=deconstruct_domain_6.Start)
addition_15 = Addition(A=multiplication_19, B=addition_14)

vector_xyz_2 = VectorXYZ(XComponent=0, YComponent=addition_13, ZComponent=addition_15)  # -> Vector, Length
move_5 = Move(Geometry=geometry_2, Motion=vector_xyz_2.Vector)  # -> Geometry, Transform

weldmesh_2 = WeldMesh(Mesh=mesh_join_4, Radius=1e-10, Align=False, Use_RTree=False)
multiplication_20 = Multiplication(A=deconstruct_domain_7.End, B=addition_9)

multiplication_21 = Multiplication(A=deconstruct_domain_7.Start, B=multiplication_14)
multiplication_22 = Multiplication(A=deconstruct_domain_5.Start, B=multiplication_13)
addition_16 = Addition(A=multiplication_22, B=multiplication_21)
division_20 = Division(A=addition_16, B=2)
addition_17 = Addition(A=deconstruct_domain_6.Start, B=division_20)
vector_xyz_3 = VectorXYZ(XComponent=multiplication_20, YComponent=addition_12, ZComponent=addition_17)  # -> Vector, Length
move_6 = Move(Geometry=geometry_2, Motion=vector_xyz_3.Vector)  # -> Geometry, Transform
mirror_13 = Mirror(Geometry=move_6.Geometry, Plane=PlaneYZ(0, 0, 0))  # -> Geometry, Transform

stream_filter_8 = StreamFilter(Gate=ⵙꕤⵙ_ⵙᴥⵙ_ⵙᴥⵙꖴⵙᙏⵙ_ⵙ_ⵙᙏⵙꖴⵙᴥⵙ_ⵙᴥⵙ_ⵙꕤⵙ, Stream0=move_5.Geometry, Stream1=[move_6.Geometry, mirror_13.Geometry])

polar_array_5 = PolarArray(Geometry=stream_filter_8, Plane=PlaneXY(0, 0, 0), Count=4, Angle=6.283185307)  # -> Geometry, Transform
rotate_9 = Rotate(Geometry=polar_array_5.Geometry, Angle=1.570796327, Plane=PlaneYZ(0, 0, 0))  # -> Geometry, Transform
polar_array_6 = PolarArray(Geometry=polar_array_5.Geometry, Plane=Plane(origin=(0, 0, 0), x=(0, 0, 1), y=(1, 0, 0)), Count=4, Angle=6.283185307)  # -> Geometry, Transform
rotate_10 = Rotate(Geometry=polar_array_5.Geometry, Angle=1.570796327, Plane=Plane(origin=(0, 0, 0), x=(0, -1, 0), y=(0, 0, 1)))  # -> Geometry, Transform

geometry_4 = Geometry(flatten([polar_array_6.Geometry, rotate_10.Geometry, rotate_9.Geometry]))
bounding_box_7 = BoundingBox(Content=geometry_4, Plane=PlaneXY(0, 0, 0), UnionBox=True)  # -> Box, Box_2
deconstruct_box_5 = DeconstructBox(Box=bounding_box_7.Box)  # -> Plane, X, Y, Z
panel_82 = Panel(deconstruct_box_5.X)
export_file_to_path_2 = ExportFileToPath(Run=Toggle(False), GeometryToExport=geometry_4, ExportPath="C:\JBO.BB42.XHG.FXD.FXD.DXF.DXF.GHX.24BB.OBJ")

ungroup = Ungroup(Group=geometry_4)  # -> flatten(Objects)
bounding_box_8 = BoundingBox(Content=ungroup, Plane=PlaneXY(0, 0, 0), UnionBox=True)  # -> Box, Box_2
mesh_join_5 = MeshJoin(Meshes=ungroup)  # -> flatten(Mesh)
deconstruct_box_6 = DeconstructBox(Box=bounding_box_8.Box)  # -> Plane, X, Y, Z

export_as = ExportAs(
    Geometry=mesh_join_5,
    FileLocation="C:\JBO.BB42.XHG.JBO.PIH.FXD.FXD.DXF.DXF.HIP.OBJ.GHX.24BB.OBJ",
    Overwrite=Toggle(False),
    Export=Toggle(False),
    CompMode=False,
    LastSaveLocalization="neutral,N")  # -> OK, ExportCommand
