# Grasshopper definition XHG.⠀⠀⠀⠀⠀⠀⠀⠀ⵙ⠀ᙁ⠀ⵙ⠀ᗩ⠀ⵙ⠀✤⠀ⵙ⠀ᑐᑕ⠀ⵙ⠀ᗩ⠀ⵙ⠀ᴥ⠀ⵙ⠀ꗳ⠀ⵙ⠀⠀⠀⠀◯⠀⠀⠀⠀ⵙ⠀ИN⠀ⵙ⠀ᗩ⠀ⵙ⠀ꖴ⠀ⵙ⠀ИN⠀ⵙ⠀Ⓞ⠀ⵙ⠀ᙁ⠀ⵙ⠀Ⓞ⠀ⵙ⠀ߦ⠀ⵙ⠀ᗩ⠀ⵙ⠀⠀⠀⠀⠀⠀⠀⠀◯⠀⠀⠀⠀⠀⠀⠀⠀ⵙ⠀⠀⠀⠀⠀⠀⠀⠀◯⠀⠀⠀⠀⠀⠀⠀⠀ⵙ⠀ᗩ⠀ⵙ⠀ߦ⠀ⵙ⠀Ⓞ⠀ⵙ⠀ᙁ⠀ⵙ⠀Ⓞ⠀ⵙ⠀ИN⠀ⵙ⠀ꖴ⠀ⵙ⠀ᗩ⠀ⵙ⠀ИN⠀ⵙ⠀⠀⠀⠀◯⠀⠀⠀⠀ⵙ⠀ꗳ⠀ⵙ⠀ᴥ⠀ⵙ⠀ᗩ⠀ⵙ⠀ᑐᑕ⠀ⵙ⠀✤⠀ⵙ⠀ᗩ⠀ⵙ⠀ᙁ⠀ⵙ⠀⠀⠀⠀⠀⠀⠀⠀.GHX (Grasshopper 1.0.7)
# plug-ins: Anemone

polygon = Polygon(Plane=PlaneXY(0, 0, 0), Radius=1, Segments=5, FilletRadius=0)  # -> Polygon, Length
fast_loop_start = FastLoopStart(Iterations=Slider(2, range=0..4), Data=polygon.Polygon)  # -> port, Counter, Data
explode = Explode(Curve=fast_loop_start.Data, Recursive=True)  # -> Segments, Vertices
area = Area(Geometry=fast_loop_start.Data)  # -> Area, Centroid
list_item = ListItem(List=explode.Segments, Index=0, Wrap=False)  # -> flatten(Item), flatten(Item1), flatten(Item2)
circle_tantantan = CircleTanTanTan(CurveA=list_item.Item, CurveB=list_item.Item1, CurveC=list_item.Item2, Point=area.Centroid)
number_slider = Slider(6, range=0..16)
scale = Scale(Geometry=fast_loop_start.Data, Center=Point(0, 0, 0), Factor=expr("2^X", number_slider))  # -> Geometry, Transform
scale_2 = Scale(Geometry=circle_tantantan, Center=Point(0, 0, 0), Factor=expr("2^X", number_slider))  # -> Geometry, Transform
region_difference = RegionDifference(CurvesA=scale.Geometry, CurvesB=scale_2.Geometry)
scale_3 = Scale(Geometry=region_difference, Center=Point(0, 0, 0), Factor=expr("1/2^X", number_slider))  # -> Geometry, Transform
fast_loop_end = FastLoopEnd(port=fast_loop_start.port, Exit=False, Data=scale_3.Geometry, RecordData=False, TimeOutVal=0)  # -> flatten(Data)
divide_curve = DivideCurve(Curve=circle_tantantan, Count=4, Kinks=False)  # -> Points, Tangents, Parameters
list_item_2 = ListItem(List=divide_curve.Points, Index=0, Wrap=False)  # -> Item, Item1, Item2, Item3
sphere_4pt = Sphere4Pt(Point1=list_item_2.Item, Point2=list_item_2.Item1, Point3=list_item_2.Item2, Point4=list_item_2.Item3)  # -> Center, Radius, Sphere
