# Grasshopper definition XHG...ⵙᗱᗴⵙ✤ⵙᗩⵙᙁⵙߦⵙ◯ⵙ옷ⵙߦⵙᗩⵙᴥⵙᕤᕦⵙ◯ⵙᴥⵙᗱᗴⵙᗝⵙᗩⵙ옷ⵙᔓᔕⵙ⊚ⵙ◌ⵙ⊚ⵙ◌ⵙ⊚ⵙ◌ⵙ⚪ⵙ◯ⵙ◯ⵙ⚪ⵙ◌ⵙ⊚ⵙ◌ⵙ⊚ⵙ◌ⵙ⊚ⵙᔓᔕⵙ옷ⵙᗩⵙᗝⵙᗱᗴⵙᴥⵙ◯ⵙᕤᕦⵙᴥⵙᗩⵙߦⵙ옷ⵙ◯ⵙߦⵙᙁⵙᗩⵙ✤ⵙᗱᗴⵙ...GHX (Grasshopper 1.0.7)
# plug-ins: MeshEdit Components, NGon, Mesh Pipe, Weaverbird

digit_scroller = DigitScroller(Scroller_Digits=12, Scroller_Prefix="Digit Scroller", Scroller_Radix=11, Scroller_Value=8192)
quad_remesh_settings = QuadRemeshSettings(
    TargetCount=digit_scroller,
    AdaptiveSize=100,
    AdaptiveCount=True,
    HardEdges=False,
    SeamEdges=0,
    Symmetry=0,
    GuideCurves=2)
faces = Faces({A=0, B=1, C=2, D=3})
digit_scroller_2 = DigitScroller(Scroller_Digits=12, Scroller_Prefix="✺", Scroller_Radix=11, Scroller_Value=4)
line = Line(StartPoint=Point(1, 0, 0), EndPoint=Point(1, 1, 0))
move = Move(Geometry=line, Motion=Vector(-1, 0, 0))  # -> Geometry, Transform
digit_scroller_3 = DigitScroller(Scroller_Digits=12, Scroller_Prefix=" ", Scroller_Radix=11, Scroller_Value=6)
digit_scroller_4 = DigitScroller(Scroller_Digits=12, Scroller_Prefix="✺", Scroller_Radix=11, Scroller_Value=6)
power = Power(A=2, B=digit_scroller_4)
digit_scroller_5 = DigitScroller(Scroller_Digits=12, Scroller_Prefix="✺", Scroller_Radix=11, Scroller_Value=256)
range = Range(Domain=Domain(-2, -1), Steps=digit_scroller_5)
expression = Expression(O=range, Expression="1-((1-(-O*1-2)^2)^(600.5/256/19.48046875)*(.65625)+(1-.65625))")
construct_point = ConstructPoint(XCoordinate=range, YCoordinate=expression, ZCoordinate=0)
interpolate_t = InterpolateT(Vertices=reverse(construct_point), TangentStart=Vector(0, 1, 0), TangentEnd=Vector(1, 0, 0), KnotStyle=1)  # -> Curve, Length, Domain
curve = Curve(interpolate_t.Curve)
digit_scroller_6 = DigitScroller(Scroller_Digits=12, Scroller_Prefix="✺", Scroller_Radix=11, Scroller_Value=128)
divide_curve = DivideCurve(Curve=curve, Count=digit_scroller_6, Kinks=False)  # -> Points, Tangents, Parameters
interpolate_t_2 = InterpolateT(Vertices=divide_curve.Points, TangentStart=Vector(0, 1, 0), TangentEnd=Vector(1, 0, 0), KnotStyle=1)  # -> Curve, Length, Domain
curve_2 = Curve(interpolate_t_2.Curve)
evaluate_length = EvaluateLength(Curve=curve_2, Length=1, Normalized=True)  # -> Point, Tangent, Parameter
yz_plane = YZPlane(Origin=evaluate_length.Point)
digit_scroller_7 = DigitScroller(Scroller_Digits=12, Scroller_Prefix=" ", Scroller_Radix=11, Scroller_Value=87)
multiplication = Multiplication(A=power, B=0.125)
divide_curve_2 = DivideCurve(Curve=curve_2, Count=multiplication, Kinks=False)  # -> Points, Tangents, Parameters
polyline = PolyLine(Vertices=divide_curve_2.Points, Closed=False)
power_2 = Power(A=2, B=digit_scroller_4)
subtraction = Subtraction(A=digit_scroller_4, B=digit_scroller_3)
power_3 = Power(A=2, B=subtraction)
one_over_x = OneOverX(Value=power_3)
multiplication_2 = Multiplication(A=power_2, B=one_over_x)
range_2 = Range(Domain=Domain(0.75, 1), Steps=expr("X/4", multiplication_2))
multiplication_3 = Multiplication(A=range_2, B=6.283185307)
consecutive_domains = ConsecutiveDomains(Numbers=multiplication_3, Additive=False)
range_3 = Range(Domain=Domain(1, 2), Steps=expr("X/2", multiplication_2))

# ---- group: 0
evaluate_length_2 = EvaluateLength(Curve=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, Length=0, Normalized=True)  # -> Point, Tangent, Parameter

# ----
yz_plane_2 = YZPlane(Origin=evaluate_length_2.Point)
range_4 = Range(Domain=Domain(-1, 0), Steps=digit_scroller_5)
expression_2 = Expression(O=range_4, Expression="(1-(O*1-0)^2)^(600.5/256/19.48046875)*(1-.65625)+.65625")
construct_point_2 = ConstructPoint(XCoordinate=range_4, YCoordinate=expression_2, ZCoordinate=0)
interpolate_t_3 = InterpolateT(Vertices=construct_point_2, TangentStart=Vector(0, 1, 0), TangentEnd=Vector(1, 0, 0), KnotStyle=1)  # -> Curve, Length, Domain
curve_3 = Curve(interpolate_t_3.Curve)
divide_curve_3 = DivideCurve(Curve=curve_3, Count=digit_scroller_6, Kinks=False)  # -> Points, Tangents, Parameters
interpolate_t_4 = InterpolateT(Vertices=divide_curve_3.Points, TangentStart=Vector(0, 1, 0), TangentEnd=Vector(1, 0, 0), KnotStyle=1)  # -> Curve, Length, Domain
curvature_graph = CurvatureGraph(Curve=interpolate_t_4.Curve, Density=1, Scale=digit_scroller_7)  # disabled
curve_4 = Curve(interpolate_t_4.Curve)
divide_curve_4 = DivideCurve(Curve=curve_4, Count=multiplication, Kinks=False)  # -> Points, Tangents, Parameters
polyline_2 = PolyLine(Vertices=divide_curve_4.Points, Closed=False)
merge = Merge(Data1=polyline_2, Data2=polyline)
mirror = Mirror(Geometry=merge, Plane=yz_plane)  # -> Geometry, Transform
merge_2 = Merge(Data1=merge, Data2=mirror.Geometry)
join_curves = JoinCurves(Curves=merge_2, Preserve=False)
rotate = Rotate(Geometry=join_curves, Angle=-1.570796327, Plane=yz_plane_2)  # -> Geometry, Transform
flip_curve = FlipCurve(Curve=rotate.Geometry)  # -> Curve, Flag
evaluate_length_3 = EvaluateLength(Curve=join_curves, Length=0, Normalized=True)  # -> Point, Tangent, Parameter

revolution = Revolution(Curve=join_curves, Axis=move.Geometry, Domain=consecutive_domains)

mirror_2 = Mirror(Geometry=join_curves, Plane=yz_plane_2)  # -> Geometry, Transform
xz_plane = XZPlane(Origin=evaluate_length_3.Point)
merge_3 = Merge(Data1=join_curves, Data2=mirror_2.Geometry)
join_curves_2 = JoinCurves(Curves=merge_3, Preserve=False)
rotate_2 = Rotate(Geometry=join_curves_2, Angle=-1.570796327, Plane=yz_plane_2)  # -> Geometry, Transform
evaluate_length_4 = EvaluateLength(Curve=rotate_2.Geometry, Length=0.5, Normalized=True)  # -> Point, Tangent, Parameter
bounding_box = BoundingBox(Content=rotate_2.Geometry, Plane=PlaneXY(0, 0, 0), UnionBox=True)  # -> Box, Box_2
deconstruct_box = DeconstructBox(Box=bounding_box.Box)  # -> Plane, X, Y, Z
deconstruct_domain = DeconstructDomain(Domain=deconstruct_box.X)  # -> Start, End
line_sdl = LineSDL(Start=evaluate_length_3.Point, Direction=Vector(0, -1, 0), Length=1)
xy_plane = XYPlane(Origin=evaluate_length_2.Point)
xz_plane_2 = XZPlane(Origin=evaluate_length_2.Point)

polygon = Polygon(Plane=xz_plane_2, Radius=deconstruct_domain.End, Segments=multiplication_2, FilletRadius=0)  # -> Polygon, Length
simple_mesh = SimpleMesh(Brep=revolution)

curve_domain = CurveDomain(Curve=polygon.Polygon)  # -> Curve, Domain
deconstruct_domain_2 = DeconstructDomain(Domain=curve_domain.Domain)  # -> Start, End
construct_domain = ConstructDomain(DomainStart=expr("2*X/4", deconstruct_domain_2.End), DomainEnd=expr("3*X/4", deconstruct_domain_2.End))
sub_curve = SubCurve(BaseCurve=curve_domain.Curve, Domain=construct_domain)

evaluate_length_5 = EvaluateLength(Curve=sub_curve, Length=1, Normalized=True)  # -> Point, Tangent, Parameter
rotate_3 = Rotate(Geometry=rotate_2.Geometry, Angle=-1.570796327, Plane=xz_plane_2)  # -> Geometry, Transform
rotate_4 = Rotate(Geometry=rotate_3.Geometry, Angle=-1.570796327, Plane=xy_plane)  # -> Geometry, Transform
digit_scroller_8 = DigitScroller(Scroller_Digits=12, Scroller_Prefix=" ", Scroller_Radix=11, Scroller_Value=91)
c_script = CSharpScript(C=curve_4)  # -> out, Cmax, Cmin, Pmax, Pmin; inputs C: Curve
# ---------- c_script: C# ----------
    double tmin = double.MaxValue;
    double tmax = double.MinValue;
    double t0 = 0, t1 = 0;

    int samples = C.SpanCount * 100;
    for (int i = 0; i <= samples; i++)
    {
      double t = (double) i / samples;
      t = C.Domain.ParameterAt(t);

      Vector3d curvature = C.CurvatureAt(t);
      double length = curvature.Length;

      if (length < tmin)
      {
        tmin = length;
        t0 = t;
      }

      if (length > tmax)
      {
        tmax = length;
        t1 = t;
      }
    }

    Cmin = t0;
    Cmax = t1;
    Pmin = C.PointAt(t0);
    Pmax = C.PointAt(t1);
# ---------- end c_script ----------
curvature = Curvature(Curve=curve_4, Parameter=c_script.Cmax)  # -> Point, Curvature, Curvature_2
deconstruct_arc = DeconstructArc(Arc=curvature.Curvature_2)  # -> BasePlane, Radius, Angle
division = Division(A=deconstruct_arc.Radius, B=deconstruct_domain.End)
multiplication_4 = Multiplication(A=range_3, B=3.141592654)
consecutive_domains_2 = ConsecutiveDomains(Numbers=multiplication_4, Additive=False)
vector_2pt = Vector2Pt(PointA=evaluate_length_2.Point, PointB=evaluate_length_3.Point, Unitize=False)  # -> Vector, Length
move_2 = Move(Geometry=rotate_4.Geometry, Motion=vector_2pt.Vector)  # -> Geometry, Transform
scale = Scale(Geometry=move_2.Geometry, Center=evaluate_length_3.Point, Factor=division)  # -> Geometry, Transform
sweep1 = Sweep1(Rail=flip_curve.Curve, Sections=scale.Geometry, Miter=2)
simple_mesh_2 = SimpleMesh(Brep=sweep1)
curve_domain_2 = CurveDomain(Curve=scale.Geometry)  # -> Curve, Domain
deconstruct_domain_3 = DeconstructDomain(Domain=curve_domain_2.Domain)  # -> Start, End
curve_domain_3 = CurveDomain(Curve=rotate_2.Geometry)  # -> Curve, Domain; disabled
division_2 = Division(A=deconstruct_domain_3.End, B=2)
construct_domain_2 = ConstructDomain(DomainStart=deconstruct_domain_3.Start, DomainEnd=division_2)
sub_curve_2 = SubCurve(BaseCurve=curve_domain_2.Curve, Domain=construct_domain_2)
revolution_2 = Revolution(Curve=sub_curve_2, Axis=line_sdl, Domain=consecutive_domains_2)
bounding_box_2 = BoundingBox(Content=revolution_2, Plane=PlaneXY(0, 0, 0), UnionBox=True)  # -> Box, Box_2
deconstruct_box_2 = DeconstructBox(Box=bounding_box_2.Box)  # -> Plane, X, Y, Z
deconstruct_domain_4 = DeconstructDomain(Domain=deconstruct_box_2.Z)  # -> Start, End
offset_curve = OffsetCurve(
    Curve=rotate.Geometry,
    Distance=deconstruct_domain_4.Start,
    Plane=Plane(origin=(0, 0, 0), x=(0, 0, 1), y=(1, 0, 0)),
    Corners=1)
offset_curve_2 = OffsetCurve(
    Curve=rotate.Geometry,
    Distance=deconstruct_domain_4.End,
    Plane=Plane(origin=(0, 0, 0), x=(0, 0, 1), y=(1, 0, 0)),
    Corners=1)

polygon_2 = Polygon(Plane=xz_plane, Radius=deconstruct_domain_4.End, Segments=multiplication_2, FilletRadius=0)  # -> Polygon, Length
simple_mesh_3 = SimpleMesh(Brep=revolution_2)

curve_domain_4 = CurveDomain(Curve=polygon_2.Polygon)  # -> Curve, Domain
deconstruct_domain_5 = DeconstructDomain(Domain=curve_domain_4.Domain)  # -> Start, End
construct_domain_3 = ConstructDomain(DomainStart=expr("X/4", deconstruct_domain_5.End), DomainEnd=expr("3*X/4", deconstruct_domain_5.End))
sub_curve_3 = SubCurve(BaseCurve=curve_domain_4.Curve, Domain=construct_domain_3)
subtraction_2 = Subtraction(A=deconstruct_domain.Start, B=deconstruct_domain_4.End)
vector_xyz = VectorXYZ(XComponent=0, YComponent=0, ZComponent=expr("X-1", subtraction_2))  # -> Vector, Length
move_3 = Move(Geometry=offset_curve, Motion=vector_xyz.Vector)  # -> Geometry, Transform
end_points = EndPoints(Curve=move_3.Geometry)  # -> Start, End
line_2 = Line(StartPoint=end_points.Start, EndPoint=end_points.End)
move_4 = Move(Geometry=offset_curve_2, Motion=vector_xyz.Vector)  # -> Geometry, Transform
evaluate_length_6 = EvaluateLength(Curve=move_4.Geometry, Length=1, Normalized=True)  # -> Point, Tangent, Parameter
merge_4 = Merge(Data1=line_2, Data2=move_3.Geometry)
join_curves_3 = JoinCurves(Curves=merge_4, Preserve=False)
from_polylines = FromPolylines(Curves=merge_4, Min_Triangulation=False)
weaverbird_s_catmull_clark_subdivision = WeaverbirdsCatmullClarkSubdivision(MeshCurves=from_polylines, Level=1, SmoothNakedEdges=0)  # disabled
quadrangulate = Quadrangulate(Mesh=join_curves_3, Angle=0, Ratio=0)  # -> Mesh, Count
line_3 = Line(StartPoint=evaluate_length_6.Point, EndPoint=evaluate_length_5.Point)
move_5 = Move(Geometry=sub_curve_3, Motion=vector_xyz.Vector)  # -> Geometry, Transform
evaluate_length_7 = EvaluateLength(Curve=move_5.Geometry, Length=1, Normalized=True)  # -> Point, Tangent, Parameter
line_sdl_2 = LineSDL(Start=evaluate_length_7.Point, Direction=Vector(-3.8125, 0, 0), Length=expr("X*2+1", deconstruct_domain_4.End))
merge_5 = Merge(Data1=move_5.Geometry, Data2=move_4.Geometry, Data3=line_3, Data4=line_sdl_2)
mirror_3 = Mirror(Geometry=merge_5, Plane=Plane(origin=(0, 0, 0), x=(0, 1, 0), y=(0.7071067812, 0, 0.7071067812)))  # -> Geometry, Transform
flip_curve_2 = FlipCurve(Curve=mirror_3.Geometry)  # -> Curve, Flag
merge_6 = Merge(Data1=sub_curve, Data2=merge_5, Data3=flip_curve_2.Curve)  # -> flatten(Result)
join_curves_4 = JoinCurves(Curves=merge_6, Preserve=False)
from_polylines_2 = FromPolylines(Curves=join_curves_4, Min_Triangulation=False)
weaverbird_s_catmull_clark_subdivision_2 = WeaverbirdsCatmullClarkSubdivision(MeshCurves=from_polylines_2, Level=1, SmoothNakedEdges=0)  # disabled
quadrangulate_2 = Quadrangulate(Mesh=join_curves_4, Angle=0, Ratio=0)  # -> Mesh, Count
quad_remesh = QuadRemesh(Mesh=from_polylines_2, Guides=join_curves_4, Settings=quad_remesh_settings)  # disabled
move_6 = Move(Geometry=simple_mesh_2, Motion=vector_xyz.Vector)  # -> Geometry, Transform
polar_array = PolarArray(Geometry=move_6.Geometry, Plane=xz_plane_2, Count=4, Angle=6.283185307)  # -> Geometry, Transform; disabled
merge_7 = Merge(Data1=simple_mesh, Data2=polar_array.Geometry)  # -> flatten(Result)
mesh_join = MeshJoin(Meshes=merge_7)
mirror_4 = Mirror(Geometry=simple_mesh_3, Plane=PlaneYZ(0, 0, 0))  # -> Geometry, Transform; disabled
merge_8 = Merge(Data1=simple_mesh_3, Data2=simple_mesh_2, Data3=mirror_4.Geometry)  # -> flatten(Result)
mesh_join_2 = MeshJoin(Meshes=merge_8)
deconstruct_domain_6 = DeconstructDomain(Domain=curve_domain_3.Domain)  # -> Start, End; disabled
division_3 = Division(A=deconstruct_domain_6.End, B=2)  # disabled
construct_domain_4 = ConstructDomain(DomainStart=deconstruct_domain_6.Start, DomainEnd=division_3)  # disabled
sub_curve_4 = SubCurve(BaseCurve=curve_domain_3.Curve, Domain=construct_domain_4)  # disabled
line_sdl_3 = LineSDL(Start=Point(0, 1, 0), Direction=Vector(-2.8125, 0, -2.8125), Length=8)
eval = EvaluateCurve(Curve=curve_4, Parameter=c_script.Cmax)  # -> Point, Tangent, Angle; disabled
move_7 = Move(Geometry=simple_mesh_3, Motion=vector_xyz.Vector)  # -> Geometry, Transform
merge_9 = Merge(Data1=move_6.Geometry, Data2=quadrangulate.Mesh, Data3=move_7.Geometry)
mirror_5 = Mirror(Geometry=merge_9, Plane=Plane(origin=(0, 0, 0), x=(0, 1, 0), y=(0.7071067812, 0, 0.7071067812)))  # -> Geometry, Transform
merge_10 = Merge(Data1=simple_mesh, Data2=quadrangulate_2.Mesh, Data3=move_6.Geometry, Data4=merge_9, Data5=mirror_5.Geometry)  # -> flatten(Result)
mesh_join_3 = MeshJoin(Meshes=merge_10)
mirror_6 = Mirror(Geometry=mesh_join_3, Plane=PlaneYZ(0, 0, 0))  # -> Geometry, Transform
merge_11 = Merge(Data1=mesh_join_3, Data2=mirror_6.Geometry)
mirror_7 = Mirror(Geometry=merge_11, Plane=Plane(origin=(0, 0, 0), x=(0, 1, 0), y=(1, 0, 0)))  # -> Geometry, Transform
merge_12 = Merge(Data1=merge_11, Data2=mirror_7.Geometry)
mesh_join_4 = MeshJoin(Meshes=merge_12)
move_8 = Move(Geometry=mesh_join_4, Motion=Vector(0, -1, 0))  # -> Geometry, Transform
rotate_5 = Rotate(Geometry=move_8.Geometry, Angle=-1.570796327, Plane=PlaneYZ(0, 0, 0))  # -> Geometry, Transform
bounding_box_3 = BoundingBox(Content=rotate_5.Geometry, Plane=PlaneXY(0, 0, 0), UnionBox=True)  # -> Box, Box_2
deconstruct_box_3 = DeconstructBox(Box=bounding_box_3.Box)  # -> Plane, X, Y, Z
deconstruct_domain_7 = DeconstructDomain(Domain=deconstruct_box_3.X)  # -> expr("ABS(X)", Start), End
addition = Addition(A=deconstruct_domain_7.Start, B=deconstruct_domain_7.End)
one_over_x_2 = OneOverX(Value=addition)
mesh_weldvertices = MeshWeldVertices(Mesh=rotate_5.Geometry, Tolerance=5.960464478e-08)  # -> RuntimeMessage, Mesh
scale_2 = Scale(Geometry=mesh_weldvertices.Mesh, Center=Point(0, 0, 0), Factor=one_over_x_2)  # -> Geometry, Transform
panel = Panel(scale_2.Geometry)
mesh_join_5 = MeshJoin(Meshes=move_6.Geometry)
evaluate_length_8 = EvaluateLength(Curve=sub_curve_2, Length=0, Normalized=True)  # -> Point, Tangent, Parameter
mesh_sweep = MeshSweep(
    RailCurve=flip_curve.Curve,
    SectionCurve=scale.Geometry,
    Accuracy=0.000244140625,
    Cap=False,
    Autoorient=True,
    Rotation=-1.570796327)
move_9 = Move(Geometry=mesh_join_5, Motion=vector_xyz.Vector)  # -> Geometry, Transform; disabled
move_10 = Move(Geometry=mesh_join_2, Motion=vector_xyz.Vector)  # -> Geometry, Transform
bounding_box_4 = BoundingBox(Content=mesh_sweep, Plane=PlaneXY(0, 0, 0), UnionBox=True)  # -> Box, Box_2
deconstruct_box_4 = DeconstructBox(Box=bounding_box_4.Box)  # -> Plane, X, Y, Z
deconstruct_domain_8 = DeconstructDomain(Domain=deconstruct_box_4.Y)  # -> Start, End
subtraction_3 = Subtraction(A=deconstruct_domain_8.End, B=deconstruct_domain_8.Start)
digit_scroller_9 = DigitScroller(Scroller_Digits=12, Scroller_Prefix="Digit Scroller", Scroller_Radix=11, Scroller_Value=16)
vector_xyz_2 = VectorXYZ(XComponent=0, YComponent=expr("-X/2", subtraction_3), ZComponent=0)  # -> Vector, Length
move_11 = Move(Geometry=mesh_sweep, Motion=vector_xyz_2.Vector)  # -> Geometry, Transform
