# Grasshopper definition XHG.⠀⠀⠀⠀ⵙ⠀✤⠀ⵙ⠀ᴥ⠀ⵙ⠀Ⓞ⠀ⵙ⠀ߦ⠀ⵙ⠀ꕤ⠀ⵙ⠀ᗱᗴ⠀ⵙ⠀◯⠀ⵙ⠀ᒍᒐ⠀ⵙ⠀8⠀ⵙ⠀Ⓞ⠀ⵙ⠀⠀⠀⠀◯⠀⠀⠀⠀ⵙ⠀⠀⠀⠀◯⠀⠀⠀⠀ⵙ⠀Ⓞ⠀ⵙ⠀8⠀ⵙ⠀ᒍᒐ⠀ⵙ⠀◯⠀ⵙ⠀ᗱᗴ⠀ⵙ⠀ꕤ⠀ⵙ⠀ߦ⠀ⵙ⠀Ⓞ⠀ⵙ⠀ᴥ⠀ⵙ⠀✤⠀ⵙ⠀⠀⠀⠀.GHX (Grasshopper 1.0.7)
# plug-ins: Pancake

panel = Panel("9^-3.203125*7257.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")
panel_2 = Panel("0")
settings_custom = SettingsCustom(
    StitchSeams=False,
    SimplePlanes=True,
    Refine=False,
    MinCount=0,
    MaxCount=0,
    AspectRatio=0,
    MaxDistance=0,
    MaxAngle="1.40625*1.796875",
    MinEdge=panel,
    MaxEdge=0)
number = Number(panel)
geometry = Geometry(<brep referenced from the Rhino model>)
mesh_brep = MeshBrep(Brep=geometry, Settings=settings_custom)
panel_3 = Panel(mesh_brep)
export_as = ExportAs(Geometry=mesh_brep, Overwrite=False, Export=False, CompMode=False, LastSaveLocalization="neutral,N")  # -> OK, ExportCommand
