# Grasshopper definition XHG.⠀ⵙᔓᔕⵙᗱᗴⵙᴥⵙᑎⵙ✤ⵙᗩⵙᗯⵙᴥⵙᑎⵙᑐᑕⵙ◯ⵙᗝⵙᗱᗴⵙߦⵙᗩⵙᙏⵙ◯ⵙ∷ⵙ◯ⵙᔓᔕⵙᗝⵙꖴⵙⓄⵙᙏⵙᕤᕦⵙꖴⵙᔓᔕⵙ◯ⵙᗝⵙᗱᗴⵙᗯⵙꖴⵙᴥⵙᗱᗴⵙᗝⵙ◯ⵙᗱᗴⵙᴥⵙᑎⵙ✤ⵙᗩⵙᗯⵙᴥⵙᑎⵙᑐᑕⵙ◯ⵙᴥⵙᗩⵙᗱᗴⵙИNⵙꖴⵙᙁⵙ⠀◯⠀ⵙ⠀◯⠀ⵙᙁⵙꖴⵙИNⵙᗱᗴⵙᗩⵙᴥⵙ◯ⵙᑐᑕⵙᑎⵙᴥⵙᗯⵙᗩⵙ✤ⵙᑎⵙᴥⵙᗱᗴⵙ◯ⵙᗝⵙᗱᗴⵙᴥⵙꖴⵙᗯⵙᗱᗴⵙᗝⵙ◯ⵙᔓᔕⵙꖴⵙᕤᕦⵙᙏⵙⓄⵙꖴⵙᗝⵙᔓᔕⵙ◯ⵙ∷ⵙ◯ⵙᙏⵙᗩⵙߦⵙᗱᗴⵙᗝⵙ◯ⵙᑐᑕⵙᑎⵙᴥⵙᗯⵙᗩⵙ✤ⵙᑎⵙᴥⵙᗱᗴⵙᔓᔕⵙ⠀.GHX (Grasshopper 1.0.7)
# plug-ins: Pufferfish

digit_scroller = DigitScroller(Scroller_Digits=12, Scroller_Prefix="Digit Scroller", Scroller_Radix=11, Scroller_Value=96)
number_slider = Slider(31, range=0..100)
number_slider_2 = Slider(32, range=0..100)
digit_scroller_2 = DigitScroller(Scroller_Digits=12, Scroller_Prefix="Digit Scroller", Scroller_Radix=11, Scroller_Value=64)
xz_plane = XZPlane(Origin=Point(0, 0, 0))
digit_scroller_3 = DigitScroller(Scroller_Digits=12, Scroller_Prefix="Digit Scroller", Scroller_Radix=1, Scroller_Value=0.4205597227)
digit_scroller_4 = DigitScroller(Scroller_Digits=12, Scroller_Prefix="Digit Scroller", Scroller_Radix=1, Scroller_Value=4.411602319)
digit_scroller_5 = DigitScroller(Scroller_Digits=12, Scroller_Prefix="Digit Scroller", Scroller_Radix=1, Scroller_Value=4.411602319)
number = Number(Slider(256, range=0..1024))
digit_scroller_6 = DigitScroller(Scroller_Digits=12, Scroller_Prefix="Digit Scroller", Scroller_Radix=11, Scroller_Value=88)
xz_plane_2 = XZPlane(Origin=Point(0, 0, 0))
digit_scroller_7 = DigitScroller(Scroller_Digits=12, Scroller_Prefix="Digit Scroller", Scroller_Radix=1, Scroller_Value=4.411602319)
digit_scroller_8 = DigitScroller(Scroller_Digits=12, Scroller_Prefix="Digit Scroller", Scroller_Radix=1, Scroller_Value=4.411602319)
create_material = CreateMaterial(Diffuse=RGB(191, 191, 191), Specular=RGB(255, 255, 255), Emission=RGB(0, 0, 0), Transparency=0, Shine=0)
digit_scroller_9 = DigitScroller(Scroller_Digits=12, Scroller_Prefix="Digit Scroller", Scroller_Radix=1, Scroller_Value=4.411602319)
digit_scroller_10 = DigitScroller(Scroller_Digits=12, Scroller_Prefix="Digit Scroller", Scroller_Radix=1, Scroller_Value=4.411602319)

digit_scroller_11 = DigitScroller(Scroller_Digits=12, Scroller_Prefix="Digit Scroller", Scroller_Radix=11, Scroller_Value=94)
number_slider_3 = Slider(31, range=0..100)
number_slider_4 = Slider(32, range=0..100)
digit_scroller_12 = DigitScroller(Scroller_Digits=12, Scroller_Prefix="Digit Scroller", Scroller_Radix=11, Scroller_Value=64)

digit_scroller_13 = DigitScroller(Scroller_Digits=12, Scroller_Prefix="Digit Scroller", Scroller_Radix=1, Scroller_Value=0.00204767472)
number_slider_5 = Slider(1, range=0..1)
panel = Panel("""16                0.526707628425
32                0.131193530865
64                0.03277086292
128              0.00819109195275
256              0.00204767472315""")
number_slider_6 = Slider(256, range=0..256)
one_over_x = OneOverX(Value=number_slider_6)
radians = Radians(Degrees="0.00204767472315")
dup = DuplicateData(Data=one_over_x, Number=number_slider_6, Order=True)
division = Division(A=0.5267076284, B=0.1311935309)
series = Series(Start=0, Step=radians, Count=number_slider_6)
turtle = DotNETVBScriptLEGACY(Forward=dup, Left=series)  # -> out, Points; inputs Forward: list, Left: list
# ---------- turtle: VB ----------
    Dim i As Integer
    Dim dir As New On3dVector(1, 0, 0)    
    Dim pos As New On3dVector(0, 0, 0) 
    Dim axis As New On3dVector(0, 0, 1)
    Dim pnts As New List(Of On3dVector)

    pnts.Add(pos)
    
    For i = 0 To Forward.Count() - 1
      Dim P As New On3dVector
      dir.Rotate(Left(i), axis)      
      P = dir * Forward(i) + pnts(i)
      pnts.Add(P)
    Next
    
    Points = pnts
# ---------- end turtle ----------
panel_2 = Panel("""16    0.52916013400
32    0.13119985428""")
panel_3 = Panel("""16    0.35233813056
32    0.08793657256""")
point = Point(turtle.Points)
interpolate = Interpolate(Vertices=turtle.Points, Degree=3, Periodic=False, KnotStyle=0)  # -> Curve, Length, Domain

division_2 = Division(A=0.008191091953, B=0.002047674723)
evaluate_length = EvaluateLength(Curve=interpolate.Curve, Length=1, Normalized=True)  # -> Point, Tangent, Parameter
line_sdl = LineSDL(Start=evaluate_length.Point, Direction=evaluate_length.Tangent, Length=1)
mirror = Mirror(Geometry=interpolate.Curve, Plane=line_sdl)  # -> Geometry, Transform
join_curves = JoinCurves(Curves=[interpolate.Curve, mirror.Geometry], Preserve=False)
end_points = EndPoints(Curve=join_curves)  # -> Start, End
line = Line(StartPoint=end_points.Start, EndPoint=end_points.End)
evaluate_length_2 = EvaluateLength(Curve=join_curves, Length=1, Normalized=True)  # -> Point, Tangent, Parameter
curve_middle = CurveMiddle(Curve=join_curves)
angle = Angle(VectorA=Vector(21.5, 0, 0), VectorB=evaluate_length_2.Tangent)  # -> Angle, Reflex
evaluate_length_3 = EvaluateLength(Curve=mirror.Geometry, Length=0, Normalized=True)  # -> Point, Tangent, Parameter
angle_2 = Angle(VectorA=Vector(1.4375, 0, 0), VectorB=line)  # -> Angle, Reflex
rotate = Rotate(Geometry=join_curves, Angle=expr("-X", angle_2.Angle), Plane=curve_middle)  # -> Geometry, Transform
vector_2pt = Vector2Pt(PointA=curve_middle, PointB=Point(0, 0, 0), Unitize=False)  # -> Vector, Length
rotate_2 = Rotate(Geometry=mirror.Geometry, Angle=3.141592654, Plane=evaluate_length_3.Point)  # -> Geometry, Transform
move = Move(Geometry=rotate.Geometry, Motion=vector_2pt.Vector)  # -> Geometry, Transform
curve_domain = CurveDomain(Curve=move.Geometry)  # -> Curve, Domain
deconstruct_domain = DeconstructDomain(Domain=curve_domain.Domain)  # -> Start, End
construct_domain = ConstructDomain(DomainStart=deconstruct_domain.End, DomainEnd=expr("X/2", deconstruct_domain.End))
sub_curve = SubCurve(BaseCurve=curve_domain.Curve, Domain=construct_domain)
evaluate_length_4 = EvaluateLength(Curve=sub_curve, Length=1, Normalized=True)  # -> Point, Tangent, Parameter
rotate_3 = Rotate(Geometry=sub_curve, Angle=3.141592654, Plane=evaluate_length_4.Point)  # -> Geometry, Transform
join_curves_2 = JoinCurves(Curves=[sub_curve, rotate_3.Geometry], Preserve=False)
rotate_4 = Rotate(Geometry=join_curves, Angle=expr("-X", angle_2.Angle), Plane=curve_middle)  # -> Geometry, Transform
bounding_box = BoundingBox(Content=join_curves_2, Plane=PlaneXY(0, 0, 0), UnionBox=True)  # -> Box, Box_2
deconstruct_box = DeconstructBox(Box=bounding_box.Box)  # -> Plane, X, Y, Z
deconstruct_domain_2 = DeconstructDomain(Domain=deconstruct_box.X)  # -> Start, End
deconstruct_domain_3 = DeconstructDomain(Domain=deconstruct_box.Y)  # -> Start, End
scale = Scale(Geometry=join_curves_2, Center=Point(0, 0, 0), Factor=expr("1/X", deconstruct_domain_2.End))  # -> Geometry, Transform
division_3 = Division(A=deconstruct_domain_2.End, B=deconstruct_domain_3.End)
curve = Curve(scale.Geometry)
bounding_box_2 = BoundingBox(Content=curve, Plane=PlaneXY(0, 0, 0), UnionBox=True)  # -> Box, Box_2
deconstruct_box_2 = DeconstructBox(Box=bounding_box_2.Box)  # -> Plane, X, Y, Z
rectangle = Rectangle(Plane=PlaneXY(0, 0, 0), XSize=deconstruct_box_2.X, YSize=deconstruct_box_2.Y, Radius=0)  # -> Rectangle, Length

number_2 = Number(number_slider_6)
curve_2 = Curve(curve)
divide_curve = DivideCurve(Curve=curve_2, Count=number_2, Kinks=False)  # -> Points, Tangents, Parameters
curvature = Curvature(Curve=curve_2, Parameter=divide_curve.Parameters)  # -> Point, Curvature, Curvature_2
deconstruct_arc = DeconstructArc(Arc=curvature.Curvature_2)  # -> BasePlane, Radius, Angle
one_over_x_2 = OneOverX(Value=deconstruct_arc.Radius)
quick_graph = QuickGraph(one_over_x_2, SortOrder=0)

curvature_graph = CurvatureGraph(Curve=curve_2, Density=1, Scale=digit_scroller_11)
series_2 = Series(Start=0, Step=one_over_x, Count=number_2)
construct_point = ConstructPoint(XCoordinate=series_2, YCoordinate=one_over_x_2, ZCoordinate=0)
polyline = PolyLine(Vertices=construct_point, Closed=False)
quick_graph_2 = QuickGraph(one_over_x_2, SortOrder=0)
explode = Explode(Curve=polyline, Recursive=True)  # -> Segments, Vertices
list_length = ListLength(List=explode.Segments)  # -> expr("X/4", Length)
list_item = ListItem(List=explode.Segments, Index=expr("X+(X/2)", list_length), Wrap=False)
list_item_2 = ListItem(List=explode.Segments, Index=expr("X-(X/2)", list_length), Wrap=False)
angle_3 = Angle(VectorA=list_item, VectorB=list_item_2)  # -> Angle, Reflex
expression = Expression(x=angle_3.Angle, Expression="Format(\"{0:R}\", x)")
degrees = Degrees(Radians=angle_3.Angle)
panel_4 = Panel(degrees)

panel_5 = Panel(division_3)
degrees_2 = Degrees(Radians=angle.Angle)
panel_6 = Panel(degrees_2)

number_3 = Number(number_slider_6)
curve_3 = Curve(join_curves)
divide_curve_2 = DivideCurve(Curve=curve_3, Count=number_3, Kinks=False)  # -> Points, Tangents, Parameters
curvature_2 = Curvature(Curve=curve_3, Parameter=divide_curve_2.Parameters)  # -> Point, Curvature, Curvature_2
deconstruct_arc_2 = DeconstructArc(Arc=curvature_2.Curvature_2)  # -> BasePlane, Radius, Angle
one_over_x_3 = OneOverX(Value=deconstruct_arc_2.Radius)
quick_graph_3 = QuickGraph(one_over_x_3, SortOrder=0)

curvature_graph_2 = CurvatureGraph(Curve=curve_3, Density=1, Scale=digit_scroller)
series_3 = Series(Start=0, Step=one_over_x, Count=number_3)
construct_point_2 = ConstructPoint(XCoordinate=series_3, YCoordinate=one_over_x_3, ZCoordinate=0)
polyline_2 = PolyLine(Vertices=construct_point_2, Closed=False)
quick_graph_4 = QuickGraph(one_over_x_3, SortOrder=0)
explode_2 = Explode(Curve=polyline_2, Recursive=True)  # -> Segments, Vertices
list_length_2 = ListLength(List=explode_2.Segments)  # -> expr("X/2", Length)
list_item_3 = ListItem(List=explode_2.Segments, Index=expr("X-1", list_length_2), Wrap=False)
list_item_4 = ListItem(List=explode_2.Segments, Index=list_length_2, Wrap=False)
angle_4 = Angle(VectorA=list_item_4, VectorB=list_item_3)  # -> Angle, Reflex
expression_2 = Expression(x=angle_4.Angle, Expression="Format(\"{0:R}\", x)")
degrees_3 = Degrees(Radians=angle_4.Angle)
panel_7 = Panel(degrees_3)

number_4 = Number(number_slider_6)
curve_4 = Curve(curve)
divide_curve_3 = DivideCurve(Curve=curve_4, Count=number_4, Kinks=False)  # -> Points, Tangents, Parameters
curvature_3 = Curvature(Curve=curve_4, Parameter=divide_curve_3.Parameters)  # -> Point, Curvature, Curvature_2
deconstruct_arc_3 = DeconstructArc(Arc=curvature_3.Curvature_2)  # -> BasePlane, Radius, Angle
one_over_x_4 = OneOverX(Value=deconstruct_arc_3.Radius)
quick_graph_5 = QuickGraph(one_over_x_4, SortOrder=0)

relative_differences = RelativeDifferences(Values=one_over_x_4)
panel_8 = Panel(relative_differences)
quick_graph_6 = QuickGraph(panel_8, SortOrder=0)

relative_differences_2 = RelativeDifferences(Values=relative_differences)
panel_9 = Panel(relative_differences_2)
quick_graph_7 = QuickGraph(panel_9, SortOrder=0)

relative_differences_3 = RelativeDifferences(Values=relative_differences_2)
panel_10 = Panel(relative_differences_3)
quick_graph_8 = QuickGraph(panel_10, SortOrder=0)

digit_scroller_14 = DigitScroller(Scroller_Digits=12, Scroller_Prefix="Digit Scroller", Scroller_Radix=11, Scroller_Value=93)
curvature_graph_3 = CurvatureGraph(Curve=curve_4, Density=1, Scale=digit_scroller_14)
series_4 = Series(Start=0, Step=expr("1/X", number_4), Count=number_4)
construct_point_3 = ConstructPoint(XCoordinate=series_4, YCoordinate=expr("X/2", one_over_x_4), ZCoordinate=0)
polyline_3 = PolyLine(Vertices=construct_point_3, Closed=False)
quick_graph_9 = QuickGraph(one_over_x_4, SortOrder=0)
number_slider_7 = Slider(31, range=0..100)
number_slider_8 = Slider(32, range=0..100)
explode_3 = Explode(Curve=polyline_3, Recursive=True)  # -> Segments, Vertices
list_length_3 = ListLength(List=explode_3.Segments)  # -> expr("X/4", Length)
digit_scroller_15 = DigitScroller(Scroller_Digits=12, Scroller_Prefix="Digit Scroller", Scroller_Radix=11, Scroller_Value=64)
list_item_5 = ListItem(List=explode_3.Segments, Index=expr("X+(X/2)", list_length_3), Wrap=False)
list_item_6 = ListItem(List=explode_3.Segments, Index=expr("X-(X/2)", list_length_3), Wrap=False)
angle_5 = Angle(VectorA=list_item_5, VectorB=list_item_6)  # -> Angle, Reflex
expression_3 = Expression(X=angle_5.Angle, Expression="Format(\"{0:R}\", x)")
degrees_4 = Degrees(Radians=angle_5.Angle)
panel_11 = Panel(degrees_4)

digit_scroller_16 = DigitScroller(Scroller_Digits=12, Scroller_Prefix="Digit Scroller", Scroller_Radix=11, Scroller_Value=93)
interpolate_2 = Interpolate(Vertices=construct_point_3, Degree=3, Periodic=False, KnotStyle=1)  # -> Curve, Length, Domain
curvature_graph_4 = CurvatureGraph(Curve=interpolate_2.Curve, Density=1, Scale=digit_scroller_16)
bounding_box_3 = BoundingBox(Content=interpolate_2.Curve, Plane=PlaneXY(0, 0, 0))  # -> Box, Box_2
deconstruct_box_3 = DeconstructBox(Box=bounding_box_3.Box)  # -> Plane, X, Y, Z
deconstruct_domain_4 = DeconstructDomain(Domain=deconstruct_box_3.X)  # -> Start, End
deconstruct_domain_5 = DeconstructDomain(Domain=deconstruct_box_3.Y)  # -> Start, End
scale_nu = ScaleNU(
    Geometry=interpolate_2.Curve,
    Plane=PlaneXY(0, 0, 0),
    ScaleX=expr("1/X", deconstruct_domain_4.End),
    ScaleY=expr(".5/X", deconstruct_domain_5.End),
    ScaleZ=1)  # -> Geometry, Transform
move_2 = Move(Geometry=scale_nu.Geometry, Motion=Vector(0, -1, 0))  # -> Geometry, Transform

curve_5 = Curve(curve_4)
curve_6 = Curve(move_2.Geometry)

number_slider_9 = Slider(40, range=0..256)
number_5 = Number(number)

digit_scroller_17 = DigitScroller(Scroller_Digits=12, Scroller_Prefix="Digit Scroller", Scroller_Radix=1, Scroller_Value=0.9905597227)
number_slider_10 = Slider(29, range=0..256)
number_6 = Number(number)

create_material_2 = CreateMaterial(Diffuse=RGB(235, 235, 235), Specular=RGB(0, 255, 255), Emission=RGB(0, 0, 0), Transparency=0.5, Shine=100)
number_slider_11 = Slider(42, range=0..256)
number_7 = Number(number)
create_material_3 = CreateMaterial(Diffuse=RGB(224, 224, 224), Specular=RGB(0, 255, 255), Emission=RGB(0, 0, 0), Transparency=0.5, Shine=100)
create_material_4 = CreateMaterial(Diffuse=RGB(242, 242, 242), Specular=RGB(0, 255, 255), Emission=RGB(0, 0, 0), Transparency=0.5, Shine=100)

number_slider_12 = Slider(40, range=0..256)
number_8 = Number(number)
create_material_5 = CreateMaterial(Diffuse=RGB(232, 232, 232), Specular=RGB(0, 255, 255), Emission=RGB(0, 0, 0), Transparency=0.5, Shine=100)
create_material_6 = CreateMaterial(Diffuse=RGB(222, 222, 222), Specular=RGB(0, 255, 255), Emission=RGB(0, 0, 0), Transparency=0.5, Shine=100)
create_material_7 = CreateMaterial(Diffuse=RGB(199, 199, 199), Specular=RGB(0, 255, 255), Emission=RGB(0, 0, 0), Transparency=0.5, Shine=100)

digit_scroller_18 = DigitScroller(Scroller_Digits=12, Scroller_Prefix="Digit Scroller", Scroller_Radix=11, Scroller_Value=93)
number_slider_13 = Slider(32, range=0..100)
number_slider_14 = Slider(31, range=0..100)
digit_scroller_19 = DigitScroller(Scroller_Digits=12, Scroller_Prefix="Digit Scroller", Scroller_Radix=11, Scroller_Value=64)

create_material_8 = CreateMaterial(Diffuse=RGB(235, 235, 235), Specular=RGB(0, 255, 255), Emission=RGB(0, 0, 0), Transparency=0.5, Shine=100)
number_slider_15 = Slider(42, range=0..256)
number_9 = Number(number)
create_material_9 = CreateMaterial(Diffuse=RGB(224, 224, 224), Specular=RGB(0, 255, 255), Emission=RGB(0, 0, 0), Transparency=0.5, Shine=100)
create_material_10 = CreateMaterial(Diffuse=RGB(242, 242, 242), Specular=RGB(0, 255, 255), Emission=RGB(0, 0, 0), Transparency=0.5, Shine=100)

number_10 = Number(number_slider_6)

series_5 = Series(Start=0, Step=expr("1/X", number_10), Count=number_10)

number_slider_16 = Slider(42, range=0..256)
number_11 = Number(number)

panel_12 = Panel("""16                0.49642790190
32                0.122908661045
64                0.030606376078
128              0.0076380878337
256              0.001908488092445""")
division_4 = Division(A=0.4964279019, B=0.122908661)
panel_13 = Panel("0.496323571135")
panel_14 = Panel("0.52916013400")
evaluate_length_5 = EvaluateLength(Curve=curve, Length=1, Normalized=True)  # -> Point, Tangent, Parameter
yz_plane = YZPlane(Origin=evaluate_length_5.Point)

deconstruct = Deconstruct(Point=evaluate_length_5.Point)  # -> XComponent, YComponent, ZComponent
construct_point_4 = ConstructPoint(XCoordinate=0, YCoordinate=deconstruct.YComponent, ZCoordinate=0)
vector_2pt_2 = Vector2Pt(PointA=construct_point_4, PointB=evaluate_length_5.Point, Unitize=False)  # -> Vector, Length

mirror_2 = Mirror(Geometry=curve, Plane=yz_plane)  # -> Geometry, Transform
join_curves_3 = JoinCurves(Curves=[curve, mirror_2.Geometry], Preserve=False)
scale_nu_2 = ScaleNU(Geometry=[curve, mirror_2.Geometry], Plane=PlaneXY(0, 0, 0), ScaleX=0.5, ScaleY=expr("-X", 0.5), ScaleZ=1)  # -> Geometry, Transform
move_3 = Move(Geometry=scale_nu_2.Geometry, Motion=Vector(1, -0.5, 0))  # -> Geometry, Transform

curve_7 = Curve(move_3.Geometry)

curve_8 = Curve(curve_7)
divide_curve_4 = DivideCurve(Curve=curve_8, Count=number_5, Kinks=False)  # -> Points, Tangents, Parameters
curvature_4 = Curvature(Curve=curve_8, Parameter=divide_curve_4.Parameters)  # -> Point, Curvature, Curvature_2
deconstruct_arc_4 = DeconstructArc(Arc=curvature_4.Curvature_2)  # -> BasePlane, Radius, Angle
one_over_x_5 = OneOverX(Value=deconstruct_arc_4.Radius)
panel_16 = Panel(one_over_x_5)
quick_graph_10 = QuickGraph(one_over_x_5, SortOrder=0)
line_2 = Line(StartPoint=curvature_4.Point, EndPoint=deconstruct_arc_4.BasePlane)
multiplication = Multiplication(A=one_over_x_5, B=Slider(0.015666, range=0..0.5))
line_sdl_2 = LineSDL(Start=curvature_4.Point, Direction=line_2, Length=expr("-ABS(X)", multiplication))
evaluate_length_6 = EvaluateLength(Curve=line_sdl_2, Length=1, Normalized=True)  # -> Point, Tangent, Parameter
interpolate_3 = Interpolate(Vertices=evaluate_length_6.Point, Degree=3, Periodic=False, KnotStyle=2)  # -> Curve, Length, Domain

nurbs_curve = NurbsCurve(Vertices=evaluate_length_6.Point, Degree=11, Periodic=False)  # -> Curve, Length, Domain
bounding_box_4 = BoundingBox(Content=interpolate_3.Curve, Plane=PlaneXY(0, 0, 0), UnionBox=True)  # -> Box, Box_2
deconstruct_box_4 = DeconstructBox(Box=bounding_box_4.Box)  # -> Plane, X, Y, Z
deconstruct_domain_6 = DeconstructDomain(Domain=deconstruct_box_4.Y)  # -> Start, End
relative_differences_4 = RelativeDifferences(Values=[deconstruct_domain_6.Start, deconstruct_domain_6.End])
list_item_7 = ListItem(List=relative_differences_4, Index=1, Wrap=False)
panel_17 = Panel(list_item_7)
curvature_graph_5 = CurvatureGraph(Curve=move_3.Geometry, Density=1, Scale=digit_scroller_6)

curve_9 = Curve(curve_7)
divide_curve_5 = DivideCurve(Curve=curve_9, Count=number_6, Kinks=False)  # -> Points, Tangents, Parameters
curvature_5 = Curvature(Curve=curve_9, Parameter=divide_curve_5.Parameters)  # -> Point, Curvature, Curvature_2
deconstruct_arc_5 = DeconstructArc(Arc=curvature_5.Curvature_2)  # -> BasePlane, Radius, Angle
line_3 = Line(StartPoint=curvature_5.Point, EndPoint=deconstruct_arc_5.BasePlane)
one_over_x_6 = OneOverX(Value=deconstruct_arc_5.Radius)
relative_differences_5 = RelativeDifferences(Values=one_over_x_6)
quick_graph_11 = QuickGraph(relative_differences_5, SortOrder=0)
multiplication_2 = Multiplication(A=relative_differences_5, B=digit_scroller_17)
panel_18 = Panel(relative_differences_5)

point_2 = Point(curvature_5.Point)

line_sdl_3 = LineSDL(Start=point_2, Direction=line_3, Length=expr("-ABS(X)", multiplication_2))
evaluate_length_7 = EvaluateLength(Curve=line_sdl_3, Length=1, Normalized=True)  # -> Point, Tangent, Parameter
interpolate_4 = Interpolate(Vertices=evaluate_length_7.Point, Degree=3, Periodic=False, KnotStyle=2)  # -> Curve, Length, Domain

nurbs_curve_2 = NurbsCurve(Vertices=evaluate_length_7.Point, Degree=11, Periodic=False)  # -> Curve, Length, Domain
mirror_3 = Mirror(Geometry=[line_sdl_3, interpolate_4.Curve], Plane=xz_plane)  # -> Geometry, Transform
move_4 = Move(Geometry=mirror_3.Geometry, Motion=Vector(0, -2.5, 0))  # -> Geometry, Transform
bounding_box_5 = BoundingBox(Content=move_4.Geometry, Plane=PlaneXY(0, 0, 0), UnionBox=True)  # -> Box, Box_2
deconstruct_box_5 = DeconstructBox(Box=bounding_box_5.Box)  # -> Plane, X, Y, Z
deconstruct_domain_7 = DeconstructDomain(Domain=deconstruct_box_5.Y)  # -> Start, End
relative_differences_6 = RelativeDifferences(Values=[deconstruct_domain_7.Start, deconstruct_domain_7.End])
list_item_8 = ListItem(List=relative_differences_6, Index=1, Wrap=False)
panel_19 = Panel(list_item_8)
division_5 = Division(A=panel_19, B=panel_17)
panel_20 = Panel(division_5)

digit_scroller_20 = DigitScroller(Scroller_Digits=12, Scroller_Prefix="Digit Scroller", Scroller_Radix=1, Scroller_Value=0.00190848809)
radians_2 = Radians(Degrees="0.001908488092445")
series_6 = Series(Start=0, Step=radians_2, Count=number_slider_6)

number_slider_17 = Slider(40, range=0..256)
number_12 = Number(number)
create_material_11 = CreateMaterial(Diffuse=RGB(232, 232, 232), Specular=RGB(0, 255, 255), Emission=RGB(0, 0, 0), Transparency=0.5, Shine=100)
create_material_12 = CreateMaterial(Diffuse=RGB(222, 222, 222), Specular=RGB(0, 255, 255), Emission=RGB(0, 0, 0), Transparency=0.5, Shine=100)
create_material_13 = CreateMaterial(Diffuse=RGB(196, 196, 196), Specular=RGB(0, 255, 255), Emission=RGB(0, 0, 0), Transparency=0.5, Shine=100)

number_slider_18 = Slider(29, range=0..256)
number_13 = Number(number)

curve_graph_mapper = CurveGraphMapper(Curves=curve, Rectangle=rectangle.Rectangle, Values=series_6, Flip=False, Snap=False, TextSize=1)  # -> Mapped, GraphCurves, GraphPoints, ValueLines, ValuePoints, MappedLines, MappedPoints, Boundary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

turtle_2 = DotNETVBScriptLEGACY(Forward=dup, Left=curve_graph_mapper.Mapped)  # -> out, Points; inputs Forward: list, Left: list; same code as turtle
point_3 = Point(turtle_2.Points)
interpolate_5 = Interpolate(Vertices=turtle_2.Points, Degree=3, Periodic=False, KnotStyle=0)  # -> Curve, Length, Domain

evaluate_length_8 = EvaluateLength(Curve=interpolate_5.Curve, Length=1, Normalized=True)  # -> Point, Tangent, Parameter
line_sdl_4 = LineSDL(Start=evaluate_length_8.Point, Direction=evaluate_length_8.Tangent, Length=1)
mirror_4 = Mirror(Geometry=interpolate_5.Curve, Plane=line_sdl_4)  # -> Geometry, Transform
join_curves_4 = JoinCurves(Curves=[interpolate_5.Curve, mirror_4.Geometry], Preserve=False)
end_points_2 = EndPoints(Curve=join_curves_4)  # -> Start, End
line_4 = Line(StartPoint=end_points_2.Start, EndPoint=end_points_2.End)
angle_6 = Angle(VectorA=Vector(1.4375, 0, 0), VectorB=line_4)  # -> Angle, Reflex
rotate_5 = Rotate(Geometry=join_curves_4, Angle=expr("-X", angle_6.Angle), Plane=evaluate_length_8.Point)  # -> Geometry, Transform
vector_2pt_3 = Vector2Pt(PointA=evaluate_length_8.Point, PointB=Point(0, 0, 0), Unitize=False)  # -> Vector, Length
move_5 = Move(Geometry=rotate_5.Geometry, Motion=vector_2pt_3.Vector)  # -> Geometry, Transform
curve_domain_2 = CurveDomain(Curve=move_5.Geometry)  # -> Curve, Domain
deconstruct_domain_8 = DeconstructDomain(Domain=curve_domain_2.Domain)  # -> Start, End
construct_domain_2 = ConstructDomain(DomainStart=expr("X/2", deconstruct_domain_8.End), DomainEnd=deconstruct_domain_8.End)
sub_curve_2 = SubCurve(BaseCurve=curve_domain_2.Curve, Domain=construct_domain_2)
evaluate_length_9 = EvaluateLength(Curve=sub_curve_2, Length=1, Normalized=True)  # -> Point, Tangent, Parameter
rotate_6 = Rotate(Geometry=sub_curve_2, Angle=3.141592654, Plane=evaluate_length_9.Point)  # -> Geometry, Transform
join_curves_5 = JoinCurves(Curves=[sub_curve_2, rotate_6.Geometry], Preserve=False)
bounding_box_6 = BoundingBox(Content=join_curves_5, Plane=PlaneXY(0, 0, 0), UnionBox=True)  # -> Box, Box_2
deconstruct_box_6 = DeconstructBox(Box=bounding_box_6.Box)  # -> Plane, X, Y, Z
scale_2 = Scale(Geometry=join_curves_5, Center=Point(0, 0, 0), Factor=expr("X^-1", deconstruct_box_6.X))  # -> Geometry, Transform
deconstruct_domain_9 = DeconstructDomain(Domain=deconstruct_box_6.X)  # -> Start, End
deconstruct_domain_10 = DeconstructDomain(Domain=deconstruct_box_6.Y)  # -> Start, End
mirror_5 = Mirror(Geometry=scale_2.Geometry, Plane=yz_plane)  # -> Geometry, Transform
division_6 = Division(A=deconstruct_domain_9.End, B=deconstruct_domain_10.End)
panel_21 = Panel(division_6)
curve_10 = Curve(mirror_5.Geometry)

curve_11 = Curve(curve_10)
divide_curve_6 = DivideCurve(Curve=curve_11, Count=number_10, Kinks=False)  # -> Points, Tangents, Parameters
curvature_6 = Curvature(Curve=curve_11, Parameter=divide_curve_6.Parameters)  # -> Point, Curvature, Curvature_2
deconstruct_arc_6 = DeconstructArc(Arc=curvature_6.Curvature_2)  # -> BasePlane, Radius, Angle
one_over_x_7 = OneOverX(Value=deconstruct_arc_6.Radius)
quick_graph_12 = QuickGraph(one_over_x_7, SortOrder=0)

relative_differences_7 = RelativeDifferences(Values=one_over_x_7)
panel_22 = Panel(relative_differences_7)
quick_graph_13 = QuickGraph(panel_22, SortOrder=0)

relative_differences_8 = RelativeDifferences(Values=relative_differences_7)
panel_23 = Panel(relative_differences_8)
quick_graph_14 = QuickGraph(panel_23, SortOrder=0)

relative_differences_9 = RelativeDifferences(Values=relative_differences_8)
panel_24 = Panel(relative_differences_9)
quick_graph_15 = QuickGraph(panel_24, SortOrder=0)

curvature_graph_6 = CurvatureGraph(Curve=curve_11, Density=1, Scale=digit_scroller_18)
construct_point_5 = ConstructPoint(XCoordinate=series_5, YCoordinate=expr("X/2", one_over_x_7), ZCoordinate=0)
polyline_4 = PolyLine(Vertices=construct_point_5, Closed=False)
quick_graph_16 = QuickGraph(one_over_x_7, SortOrder=0)
explode_4 = Explode(Curve=polyline_4, Recursive=True)  # -> Segments, Vertices
list_length_4 = ListLength(List=explode_4.Segments)  # -> expr("X/4", Length)
list_item_9 = ListItem(List=explode_4.Segments, Index=expr("X+(X/2)", list_length_4), Wrap=False)
list_item_10 = ListItem(List=explode_4.Segments, Index=expr("X-(X/2)", list_length_4), Wrap=False)
angle_7 = Angle(VectorA=list_item_9, VectorB=list_item_10)  # -> Angle, Reflex
expression_4 = Expression(X=angle_7.Angle, Expression="Format(\"{0:R}\", x)")
degrees_5 = Degrees(Radians=angle_7.Angle)
panel_25 = Panel(degrees_5)

curve_12 = Curve(curve_11)

curve_13 = Curve(graft([curve_5, curve_12]))
divide_curve_7 = DivideCurve(Curve=curve_13, Count=number_12, Kinks=False)  # -> Points, Tangents, Parameters
curvature_7 = Curvature(Curve=curve_13, Parameter=divide_curve_7.Parameters)  # -> Point, Curvature, Curvature_2
deconstruct_arc_7 = DeconstructArc(Arc=curvature_7.Curvature_2)  # -> BasePlane, Radius, Angle
line_5 = Line(StartPoint=curvature_7.Point, EndPoint=deconstruct_arc_7.BasePlane)
one_over_x_8 = OneOverX(Value=deconstruct_arc_7.Radius)
panel_26 = Panel(one_over_x_8)
quick_graph_17 = QuickGraph(one_over_x_8, SortOrder=0)
multiplication_3 = Multiplication(A=one_over_x_8, B=Slider(0.088888, range=0..0.5))
line_sdl_5 = LineSDL(Start=curvature_7.Point, Direction=line_5, Length=expr("-ABS(X)", multiplication_3))
evaluate_length_10 = EvaluateLength(Curve=line_sdl_5, Length=1, Normalized=True)  # -> Point, Tangent, Parameter
interpolate_6 = Interpolate(Vertices=evaluate_length_10.Point, Degree=3, Periodic=False, KnotStyle=2)  # -> Curve, Length, Domain
custom_preview = CustomPreview(Geometry=curve_13, Material=create_material_13)
custom_preview_2 = CustomPreview(Geometry=line_sdl_5, Material=create_material_11)
custom_preview_3 = CustomPreview(Geometry=interpolate_6.Curve, Material=create_material_12)

relative_differences_10 = RelativeDifferences(Values=one_over_x_8)

derivatives = Derivatives(Curve=curve_13, Parameter=divide_curve_7.Parameters)  # -> Point, FirstDerivative, SecondDerivative, ThirdDerivative, FourthDerivative, FifthDerivative, SixthDerivative
panel_27 = Panel(relative_differences_10)
quick_graph_18 = QuickGraph(relative_differences_10, SortOrder=0)
multiplication_4 = Multiplication(A=relative_differences_10, B=digit_scroller_4)
line_sdl_6 = LineSDL(Start=evaluate_length_10.Point, Direction=line_5, Length=expr("-ABS(X)", multiplication_4))
evaluate_length_11 = EvaluateLength(Curve=line_sdl_6, Length=1, Normalized=True)  # -> Point, Tangent, Parameter
line_sdl_7 = LineSDL(Start=evaluate_length_11.Point, Direction=derivatives.ThirdDerivative, Length=expr("-X", multiplication_4))
custom_preview_4 = CustomPreview(Geometry=line_sdl_7, Material=create_material_8)
interpolate_7 = Interpolate(Vertices=evaluate_length_11.Point, Degree=3, Periodic=False, KnotStyle=2)  # -> Curve, Length, Domain
curve_14 = Curve(interpolate_6.Curve)
divide_curve_8 = DivideCurve(Curve=curve_14, Count=number_9, Kinks=False)  # -> Points, Tangents, Parameters
curvature_8 = Curvature(Curve=curve_14, Parameter=divide_curve_8.Parameters)  # -> Point, Curvature, Curvature_2
deconstruct_arc_8 = DeconstructArc(Arc=curvature_8.Curvature_2)  # -> BasePlane, Radius, Angle
one_over_x_9 = OneOverX(Value=deconstruct_arc_8.Radius)
line_6 = Line(StartPoint=curvature_8.Point, EndPoint=deconstruct_arc_8.BasePlane)
custom_preview_5 = CustomPreview(Geometry=interpolate_7.Curve, Material=create_material_9)
custom_preview_6 = CustomPreview(Geometry=line_sdl_6, Material=create_material_10)

evaluate_length_12 = EvaluateLength(Curve=line_sdl_7, Length=1, Normalized=True)  # -> Point, Tangent, Parameter
interpolate_8 = Interpolate(Vertices=evaluate_length_12.Point, Degree=3, Periodic=False, KnotStyle=2)  # -> Curve, Length, Domain
nurbs_curve_3 = NurbsCurve(Vertices=evaluate_length_12.Point, Degree=11, Periodic=False)  # -> Curve, Length, Domain
nurbs_curve_4 = NurbsCurve(Vertices=evaluate_length_11.Point, Degree=11, Periodic=False)  # -> Curve, Length, Domain
nurbs_curve_5 = NurbsCurve(Vertices=evaluate_length_10.Point, Degree=11, Periodic=False)  # -> Curve, Length, Domain
merge = Merge(Data1=evaluate_length_11.Point)

polyline_5 = PolyLine(Vertices=curvature_7.Point, Closed=False)
explode_5 = Explode(Curve=polyline_5, Recursive=True)  # -> Segments, Vertices
curve_15 = Curve(flatten(explode_5.Segments))
length = Length(Curve=curve_15)
sort_list = SortList(Keys=length, ValuesValuesA=curve_15)  # -> Keys, ValuesValuesA
panel_28 = Panel(sort_list.Keys)
list_item_11 = ListItem(List=sort_list.Keys, Index=0, Wrap=False)

curve_16 = Curve(interpolate_6.Curve)
divide_curve_9 = DivideCurve(Curve=curve_16, Count=number_11, Kinks=False)  # -> Points, Tangents, Parameters
curvature_9 = Curvature(Curve=curve_16, Parameter=divide_curve_9.Parameters)  # -> Point, Curvature, Curvature_2
deconstruct_arc_9 = DeconstructArc(Arc=curvature_9.Curvature_2)  # -> BasePlane, Radius, Angle
one_over_x_10 = OneOverX(Value=deconstruct_arc_9.Radius)
panel_29 = Panel(one_over_x_10)
quick_graph_19 = QuickGraph(one_over_x_10, SortOrder=0)
line_7 = Line(StartPoint=curvature_9.Point, EndPoint=deconstruct_arc_9.BasePlane)
multiplication_5 = Multiplication(A=one_over_x_10, B=Slider(0.043994, range=0..0.5))
line_sdl_8 = LineSDL(Start=evaluate_length_10.Point, Direction=line_5, Length=expr("-ABS(X)", multiplication_5))
evaluate_length_13 = EvaluateLength(Curve=line_sdl_8, Length=1, Normalized=True)  # -> Point, Tangent, Parameter
interpolate_9 = Interpolate(Vertices=evaluate_length_13.Point, Degree=3, Periodic=False, KnotStyle=2)  # -> Curve, Length, Domain

nurbs_curve_6 = NurbsCurve(Vertices=evaluate_length_13.Point, Degree=11, Periodic=False)  # -> Curve, Length, Domain
dot_display = DotDisplay(Point=merge, Colour=RGB(194, 194, 194), Size=expr("X/2", list_item_11))
merge_2 = Merge(Data1=curve_5, Data2=curve_12, Data3=curve_6, Data4=curve_7)  # -> flatten(Result)
mirror_6 = Mirror(Geometry=merge_2, Plane=xz_plane)  # -> Geometry, Transform
move_6 = Move(Geometry=mirror_6.Geometry, Motion=Vector(0, -2.5, 0))  # -> Geometry, Transform
length_2 = Length(Curve=line_sdl_5)
bounding_box_7 = BoundingBox(Content=[merge_2, line_sdl_7], Plane=PlaneXY(0, 0, 0), UnionBox=True)  # -> Box, Box_2
curve_17 = Curve(curve_13)  # disabled
sort_list_2 = SortList(Keys=length_2, ValuesValuesA=line_sdl_5)  # -> reverse(Keys), reverse(ValuesValuesA)
deconstruct_box_7 = DeconstructBox(Box=bounding_box_7.Box)  # -> Plane, X, Y, Z
deconstruct_domain_11 = DeconstructDomain(Domain=deconstruct_box_7.Y)  # -> Start, End
list_item_12 = ListItem(List=sort_list_2.ValuesValuesA, Index=0, Wrap=False)
construct_domain_3 = ConstructDomain(DomainStart=expr("X*1.0971875", deconstruct_domain_11.Start), DomainEnd=expr("X*1.275", deconstruct_domain_11.End))
interpolate_10 = Interpolate(Vertices=construct_point_5, Degree=3, Periodic=False, KnotStyle=1)  # -> Curve, Length, Domain
mirror_7 = Mirror(Geometry=merge_2, Plane=xz_plane_2)  # -> Geometry, Transform
move_7 = Move(Geometry=mirror_7.Geometry, Motion=Vector(0, -2.5, 0))  # -> Geometry, Transform
panel_30 = Panel(list_item_12)
rectangle_2 = Rectangle(Plane=PlaneXY(0, 0, 0), XSize=deconstruct_box_7.X, YSize=construct_domain_3, Radius=0)  # -> Rectangle, Length
bounding_box_8 = BoundingBox(Content=interpolate_10.Curve, Plane=PlaneXY(0, 0, 0))  # -> Box, Box_2
deconstruct_box_8 = DeconstructBox(Box=bounding_box_8.Box)  # -> Plane, X, Y, Z
deconstruct_domain_12 = DeconstructDomain(Domain=deconstruct_box_8.X)  # -> Start, End
deconstruct_domain_13 = DeconstructDomain(Domain=deconstruct_box_8.Y)  # -> Start, End
scale_nu_3 = ScaleNU(
    Geometry=interpolate_10.Curve,
    Plane=PlaneXY(0, 0, 0),
    ScaleX=expr("1/X", deconstruct_domain_12.End),
    ScaleY=expr(".5/X", deconstruct_domain_13.End),
    ScaleZ=1)  # -> Geometry, Transform
move_8 = Move(Geometry=scale_nu_3.Geometry, Motion=vector_2pt_2.Vector)  # -> Geometry, Transform
move_9 = Move(Geometry=move_8.Geometry, Motion=Vector(0, -1, 0))  # -> Geometry, Transform

mirror_8 = Mirror(Geometry=curve_10, Plane=yz_plane)  # -> Geometry, Transform
scale_nu_4 = ScaleNU(Geometry=[curve_10, mirror_8.Geometry], Plane=PlaneXY(0, 0, 0), ScaleX=0.5, ScaleY=expr("-X", 0.5), ScaleZ=1)  # -> Geometry, Transform
move_10 = Move(Geometry=scale_nu_4.Geometry, Motion=Vector(2, -0.5, 0))  # -> Geometry, Transform

curve_18 = Curve([curve_5, curve_12])
divide_curve_10 = DivideCurve(Curve=curve_18, Count=number_13, Kinks=False)  # -> Points, Tangents, Parameters
curvature_10 = Curvature(Curve=curve_18, Parameter=divide_curve_10.Parameters)  # -> Point, Curvature, Curvature_2
deconstruct_arc_10 = DeconstructArc(Arc=curvature_10.Curvature_2)  # -> BasePlane, Radius, Angle
line_8 = Line(StartPoint=curvature_10.Point, EndPoint=deconstruct_arc_10.BasePlane)
one_over_x_11 = OneOverX(Value=deconstruct_arc_10.Radius)
relative_differences_11 = RelativeDifferences(Values=one_over_x_11)
quick_graph_20 = QuickGraph(relative_differences_11, SortOrder=0)
multiplication_6 = Multiplication(A=relative_differences_11, B=digit_scroller_5)
panel_31 = Panel(relative_differences_11)

point_4 = Point(curvature_10.Point)

line_sdl_9 = LineSDL(Start=point_4, Direction=line_8, Length=expr("-ABS(X)", multiplication_6))
evaluate_length_14 = EvaluateLength(Curve=line_sdl_9, Length=1, Normalized=True)  # -> Point, Tangent, Parameter
interpolate_11 = Interpolate(Vertices=evaluate_length_14.Point, Degree=3, Periodic=False, KnotStyle=2)  # -> Curve, Length, Domain

length_3 = Length(Curve=line_sdl_9)
sort_list_3 = SortList(Keys=length_3, ValuesValuesA=line_sdl_9)  # -> reverse(Keys), reverse(ValuesValuesA)
nurbs_curve_7 = NurbsCurve(Vertices=evaluate_length_14.Point, Degree=11, Periodic=False)  # -> Curve, Length, Domain
list_item_13 = ListItem(List=sort_list_3.ValuesValuesA, Index=0, Wrap=False)
panel_32 = Panel(list_item_13)
division_7 = Division(A=sort_list_3.Keys, B=sort_list_2.Keys)
panel_33 = Panel(division_7)
mirror_9 = Mirror(Geometry=[line_sdl_9, interpolate_11.Curve], Plane=xz_plane_2)  # -> Geometry, Transform
move_11 = Move(Geometry=mirror_9.Geometry, Motion=Vector(0, -2.5, 0))  # -> Geometry, Transform
merge_3 = Merge(Data1=interpolate_6.Curve, Data2=move_11.Geometry)  # -> flatten(Result)
bounding_box_9 = BoundingBox(Content=merge_3, Plane=PlaneXY(0, 0, 0), UnionBox=True)  # -> Box, Box_2

number_slider_19 = Slider(29, range=0..256)
number_14 = Number(number)
curve_19 = Curve(curve_17)
divide_curve_11 = DivideCurve(Curve=curve_19, Count=number_14, Kinks=False)  # -> Points, Tangents, Parameters
curvature_11 = Curvature(Curve=curve_19, Parameter=divide_curve_11.Parameters)  # -> Point, Curvature, Curvature_2
deconstruct_arc_11 = DeconstructArc(Arc=curvature_11.Curvature_2)  # -> BasePlane, Radius, Angle
line_9 = Line(StartPoint=curvature_11.Point, EndPoint=deconstruct_arc_11.BasePlane)
one_over_x_12 = OneOverX(Value=deconstruct_arc_11.Radius)

relative_differences_12 = RelativeDifferences(Values=one_over_x_12)
move_12 = Move(Geometry=curvature_11.Point, Motion=Vector(0, 2.5, 0))  # -> Geometry, Transform

relative_differences_13 = RelativeDifferences(Values=relative_differences_12)
quick_graph_21 = QuickGraph(relative_differences_13, SortOrder=0)
multiplication_7 = Multiplication(A=relative_differences_13, B=Slider(9.996405, range=0..16))
line_sdl_10 = LineSDL(Start=move_12.Geometry, Direction=line_9, Length=expr("-ABS(X)", multiplication_7))
evaluate_length_15 = EvaluateLength(Curve=line_sdl_10, Length=1, Normalized=True)  # -> Point, Tangent, Parameter
interpolate_12 = Interpolate(Vertices=evaluate_length_15.Point, Degree=3, Periodic=False, KnotStyle=2)  # -> Curve, Length, Domain
panel_34 = Panel(relative_differences_13)

bounds = Bounds(Numbers=relative_differences_13)
remap_numbers = RemapNumbers(Value=relative_differences_13, Source=bounds, Target=Domain(-1, 1))  # -> Mapped, Clipped
nurbs_curve_8 = NurbsCurve(Vertices=evaluate_length_15.Point, Degree=11, Periodic=False)  # -> Curve, Length, Domain
move_13 = Move(Geometry=curve_19, Motion=Vector(0, 2.5, 0))  # -> Geometry, Transform

number_slider_20 = Slider(29, range=0..256)
number_15 = Number(number)
curve_20 = Curve(curve_17)
divide_curve_12 = DivideCurve(Curve=curve_20, Count=number_15, Kinks=False)  # -> Points, Tangents, Parameters
curvature_12 = Curvature(Curve=curve_20, Parameter=divide_curve_12.Parameters)  # -> Point, Curvature, Curvature_2
deconstruct_arc_12 = DeconstructArc(Arc=curvature_12.Curvature_2)  # -> BasePlane, Radius, Angle
line_10 = Line(StartPoint=curvature_12.Point, EndPoint=deconstruct_arc_12.BasePlane)
one_over_x_13 = OneOverX(Value=deconstruct_arc_12.Radius)

relative_differences_14 = RelativeDifferences(Values=one_over_x_13)
relative_differences_15 = RelativeDifferences(Values=relative_differences_14)
move_14 = Move(Geometry=curvature_12.Point, Motion=Vector(0, 3.5, 0))  # -> Geometry, Transform

relative_differences_16 = RelativeDifferences(Values=relative_differences_15)
quick_graph_22 = QuickGraph(relative_differences_16, SortOrder=0)
multiplication_8 = Multiplication(A=relative_differences_16, B=Slider(11.450938, range=0..16))
line_sdl_11 = LineSDL(Start=move_14.Geometry, Direction=line_10, Length=expr("-ABS(X)", multiplication_8))
evaluate_length_16 = EvaluateLength(Curve=line_sdl_11, Length=1, Normalized=True)  # -> Point, Tangent, Parameter
interpolate_13 = Interpolate(Vertices=evaluate_length_16.Point, Degree=3, Periodic=False, KnotStyle=2)  # -> Curve, Length, Domain
panel_35 = Panel(relative_differences_16)

bounds_2 = Bounds(Numbers=relative_differences_16)
remap_numbers_2 = RemapNumbers(Value=relative_differences_16, Source=bounds_2, Target=Domain(-1, 1))  # -> Mapped, Clipped
nurbs_curve_9 = NurbsCurve(Vertices=evaluate_length_16.Point, Degree=11, Periodic=False)  # -> Curve, Length, Domain
move_15 = Move(Geometry=curve_20, Motion=Vector(0, 3.5, 0))  # -> Geometry, Transform

number_slider_21 = Slider(29, range=0..256)
number_16 = Number(number)
curve_21 = Curve(curve_17)
divide_curve_13 = DivideCurve(Curve=curve_21, Count=number_16, Kinks=False)  # -> Points, Tangents, Parameters
curvature_13 = Curvature(Curve=curve_21, Parameter=divide_curve_13.Parameters)  # -> Point, Curvature, Curvature_2
deconstruct_arc_13 = DeconstructArc(Arc=curvature_13.Curvature_2)  # -> BasePlane, Radius, Angle
line_11 = Line(StartPoint=curvature_13.Point, EndPoint=deconstruct_arc_13.BasePlane)
one_over_x_14 = OneOverX(Value=deconstruct_arc_13.Radius)

relative_differences_17 = RelativeDifferences(Values=one_over_x_14)
relative_differences_18 = RelativeDifferences(Values=relative_differences_17)
relative_differences_19 = RelativeDifferences(Values=relative_differences_18)

relative_differences_20 = RelativeDifferences(Values=relative_differences_19)
quick_graph_23 = QuickGraph(relative_differences_20, SortOrder=0)
multiplication_9 = Multiplication(A=relative_differences_20, B=Slider(4, range=0..4))
line_sdl_12 = LineSDL(Start=curvature_13.Point, Direction=line_11, Length=expr("-ABS(X)", multiplication_9))
evaluate_length_17 = EvaluateLength(Curve=line_sdl_12, Length=1, Normalized=True)  # -> Point, Tangent, Parameter
interpolate_14 = Interpolate(Vertices=evaluate_length_17.Point, Degree=3, Periodic=False, KnotStyle=2)  # -> Curve, Length, Domain
panel_36 = Panel(relative_differences_20)

nurbs_curve_10 = NurbsCurve(Vertices=evaluate_length_17.Point, Degree=11, Periodic=False)  # -> Curve, Length, Domain

panel_37 = Panel("""16                
32                
64                
128              
256              0.0019131912207""")
division_8 = Division(A=0.4964279019, B=0.122908661)
curve_22 = Curve(scale_2.Geometry)
evaluate_length_18 = EvaluateLength(Curve=curve_10, Length=0, Normalized=True)  # -> Point, Tangent, Parameter
yz_plane_2 = YZPlane(Origin=evaluate_length_18.Point)
vector_2pt_4 = Vector2Pt(PointA=Point(0, 0, 0), PointB=evaluate_length_18.Point, Unitize=False)  # -> Vector, Length
create_material_14 = CreateMaterial(Diffuse=RGB(255, 105, 180), Specular=RGB(255, 255, 255), Emission=RGB(0, 0, 0), Transparency=0, Shine=0)

digit_scroller_21 = DigitScroller(Scroller_Digits=12, Scroller_Prefix="Digit Scroller", Scroller_Radix=1, Scroller_Value=0.00191319122)
radians_3 = Radians(Degrees="0.0019131912207")
series_7 = Series(Start=0, Step=radians_3, Count=number_slider_6)

curve_graph_mapper_2 = CurveGraphMapper(Curves=curve_22, Rectangle=rectangle.Rectangle, Values=series_7, Flip=False, Snap=False, TextSize=1)  # -> Mapped, GraphCurves, GraphPoints, ValueLines, ValuePoints, MappedLines, MappedPoints, Boundary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

turtle_3 = DotNETVBScriptLEGACY(Forward=dup, Left=curve_graph_mapper_2.Mapped)  # -> out, Points; inputs Forward: list, Left: list; same code as turtle
point_5 = Point(turtle_3.Points)
interpolate_15 = Interpolate(Vertices=turtle_3.Points, Degree=3, Periodic=False, KnotStyle=0)  # -> Curve, Length, Domain

evaluate_length_19 = EvaluateLength(Curve=interpolate_15.Curve, Length=1, Normalized=True)  # -> Point, Tangent, Parameter
line_sdl_13 = LineSDL(Start=evaluate_length_19.Point, Direction=evaluate_length_19.Tangent, Length=1)
mirror_10 = Mirror(Geometry=interpolate_15.Curve, Plane=line_sdl_13)  # -> Geometry, Transform
join_curves_6 = JoinCurves(Curves=[interpolate_15.Curve, mirror_10.Geometry], Preserve=False)
end_points_3 = EndPoints(Curve=join_curves_6)  # -> Start, End
line_12 = Line(StartPoint=end_points_3.Start, EndPoint=end_points_3.End)
angle_8 = Angle(VectorA=Vector(1.4375, 0, 0), VectorB=line_12)  # -> Angle, Reflex
rotate_7 = Rotate(Geometry=join_curves_6, Angle=expr("-X", angle_8.Angle), Plane=evaluate_length_19.Point)  # -> Geometry, Transform
vector_2pt_5 = Vector2Pt(PointA=evaluate_length_19.Point, PointB=Point(0, 0, 0), Unitize=False)  # -> Vector, Length
move_16 = Move(Geometry=rotate_7.Geometry, Motion=vector_2pt_5.Vector)  # -> Geometry, Transform
curve_domain_3 = CurveDomain(Curve=move_16.Geometry)  # -> Curve, Domain
deconstruct_domain_14 = DeconstructDomain(Domain=curve_domain_3.Domain)  # -> Start, End
construct_domain_4 = ConstructDomain(DomainStart=expr("X/2", deconstruct_domain_14.End), DomainEnd=deconstruct_domain_14.End)
sub_curve_3 = SubCurve(BaseCurve=curve_domain_3.Curve, Domain=construct_domain_4)
evaluate_length_20 = EvaluateLength(Curve=sub_curve_3, Length=1, Normalized=True)  # -> Point, Tangent, Parameter
rotate_8 = Rotate(Geometry=sub_curve_3, Angle=3.141592654, Plane=evaluate_length_20.Point)  # -> Geometry, Transform
join_curves_7 = JoinCurves(Curves=[sub_curve_3, rotate_8.Geometry], Preserve=False)
bounding_box_10 = BoundingBox(Content=join_curves_7, Plane=PlaneXY(0, 0, 0), UnionBox=True)  # -> Box, Box_2
deconstruct_box_9 = DeconstructBox(Box=bounding_box_10.Box)  # -> Plane, X, Y, Z
scale_3 = Scale(Geometry=join_curves_7, Center=Point(0, 0, 0), Factor=expr("X^-1", deconstruct_box_9.X))  # -> Geometry, Transform
deconstruct_domain_15 = DeconstructDomain(Domain=deconstruct_box_9.X)  # -> Start, End
deconstruct_domain_16 = DeconstructDomain(Domain=deconstruct_box_9.Y)  # -> Start, End
division_9 = Division(A=deconstruct_domain_15.End, B=deconstruct_domain_16.End)
panel_41 = Panel(division_9)

move_17 = Move(Geometry=scale_3.Geometry, Motion=vector_2pt_4.Vector)  # -> Geometry, Transform

curve_23 = Curve(move_17.Geometry)
custom_preview_7 = CustomPreview(Geometry=curve_23, Material=create_material_14)

number_slider_22 = Slider(40, range=0..256)
curve_24 = Curve(curve_23)
number_17 = Number(number)
divide_curve_14 = DivideCurve(Curve=curve_24, Count=number_17, Kinks=False)  # -> Points, Tangents, Parameters
curvature_14 = Curvature(Curve=curve_24, Parameter=divide_curve_14.Parameters)  # -> Point, Curvature, Curvature_2
deconstruct_arc_14 = DeconstructArc(Arc=curvature_14.Curvature_2)  # -> BasePlane, Radius, Angle
line_13 = Line(StartPoint=curvature_14.Point, EndPoint=deconstruct_arc_14.BasePlane)
one_over_x_15 = OneOverX(Value=deconstruct_arc_14.Radius)
panel_42 = Panel(one_over_x_15)
quick_graph_24 = QuickGraph(one_over_x_15, SortOrder=0)
multiplication_10 = Multiplication(A=one_over_x_15, B=Slider(0.088888, range=0..0.5))
line_sdl_14 = LineSDL(Start=curvature_14.Point, Direction=line_13, Length=expr("-ABS(X)", multiplication_10))
evaluate_length_21 = EvaluateLength(Curve=line_sdl_14, Length=1, Normalized=True)  # -> Point, Tangent, Parameter
interpolate_16 = Interpolate(Vertices=evaluate_length_21.Point, Degree=3, Periodic=False, KnotStyle=2)  # -> Curve, Length, Domain
create_material_15 = CreateMaterial(Diffuse=RGB(232, 232, 232), Specular=RGB(0, 255, 255), Emission=RGB(0, 0, 0), Transparency=0.5, Shine=100)
create_material_16 = CreateMaterial(Diffuse=RGB(222, 222, 222), Specular=RGB(0, 255, 255), Emission=RGB(0, 0, 0), Transparency=0.5, Shine=100)
create_material_17 = CreateMaterial(Diffuse=RGB(199, 199, 199), Specular=RGB(0, 255, 255), Emission=RGB(0, 0, 0), Transparency=0.5, Shine=100)
custom_preview_8 = CustomPreview(Geometry=curve_24, Material=create_material_17)
custom_preview_9 = CustomPreview(Geometry=line_sdl_14, Material=create_material_15)
custom_preview_10 = CustomPreview(Geometry=interpolate_16.Curve, Material=create_material_16)

relative_differences_21 = RelativeDifferences(Values=one_over_x_15)

create_material_18 = CreateMaterial(Diffuse=RGB(235, 235, 235), Specular=RGB(0, 255, 255), Emission=RGB(0, 0, 0), Transparency=0.5, Shine=100)
derivatives_2 = Derivatives(Curve=curve_24, Parameter=divide_curve_14.Parameters)  # -> Point, FirstDerivative, SecondDerivative, ThirdDerivative, FourthDerivative, FifthDerivative, SixthDerivative
panel_43 = Panel(relative_differences_21)
number_slider_23 = Slider(42, range=0..256)
quick_graph_25 = QuickGraph(relative_differences_21, SortOrder=0)
multiplication_11 = Multiplication(A=relative_differences_21, B=digit_scroller_7)
line_sdl_15 = LineSDL(Start=evaluate_length_21.Point, Direction=derivatives_2.SecondDerivative, Length=expr("-ABS(X)", multiplication_11))
evaluate_length_22 = EvaluateLength(Curve=line_sdl_15, Length=1, Normalized=True)  # -> Point, Tangent, Parameter
line_sdl_16 = LineSDL(Start=evaluate_length_22.Point, Direction=derivatives_2.ThirdDerivative, Length=expr("-X", multiplication_11))
custom_preview_11 = CustomPreview(Geometry=line_sdl_16, Material=create_material_18)
interpolate_17 = Interpolate(Vertices=evaluate_length_22.Point, Degree=3, Periodic=False, KnotStyle=2)  # -> Curve, Length, Domain
curve_25 = Curve(interpolate_16.Curve)
number_18 = Number(number)
divide_curve_15 = DivideCurve(Curve=curve_25, Count=number_18, Kinks=False)  # -> Points, Tangents, Parameters
curvature_15 = Curvature(Curve=curve_25, Parameter=divide_curve_15.Parameters)  # -> Point, Curvature, Curvature_2
deconstruct_arc_15 = DeconstructArc(Arc=curvature_15.Curvature_2)  # -> BasePlane, Radius, Angle
one_over_x_16 = OneOverX(Value=deconstruct_arc_15.Radius)
line_14 = Line(StartPoint=curvature_15.Point, EndPoint=deconstruct_arc_15.BasePlane)
create_material_19 = CreateMaterial(Diffuse=RGB(224, 224, 224), Specular=RGB(0, 255, 255), Emission=RGB(0, 0, 0), Transparency=0.5, Shine=100)
create_material_20 = CreateMaterial(Diffuse=RGB(242, 242, 242), Specular=RGB(0, 255, 255), Emission=RGB(0, 0, 0), Transparency=0.5, Shine=100)
custom_preview_12 = CustomPreview(Geometry=interpolate_17.Curve, Material=create_material_19)
custom_preview_13 = CustomPreview(Geometry=line_sdl_15, Material=create_material_20)

evaluate_length_23 = EvaluateLength(Curve=line_sdl_16, Length=1, Normalized=True)  # -> Point, Tangent, Parameter
interpolate_18 = Interpolate(Vertices=evaluate_length_23.Point, Degree=3, Periodic=False, KnotStyle=2)  # -> Curve, Length, Domain
nurbs_curve_11 = NurbsCurve(Vertices=evaluate_length_23.Point, Degree=11, Periodic=False)  # -> Curve, Length, Domain
nurbs_curve_12 = NurbsCurve(Vertices=evaluate_length_22.Point, Degree=11, Periodic=False)  # -> Curve, Length, Domain
nurbs_curve_13 = NurbsCurve(Vertices=evaluate_length_21.Point, Degree=11, Periodic=False)  # -> Curve, Length, Domain
merge_4 = Merge(Data1=evaluate_length_22.Point)

polyline_6 = PolyLine(Vertices=curvature_14.Point, Closed=False)
explode_6 = Explode(Curve=polyline_6, Recursive=True)  # -> Segments, Vertices
curve_26 = Curve(flatten(explode_6.Segments))
length_4 = Length(Curve=curve_26)
sort_list_4 = SortList(Keys=length_4, ValuesValuesA=curve_26)  # -> Keys, ValuesValuesA
panel_44 = Panel(sort_list_4.Keys)
list_item_14 = ListItem(List=sort_list_4.Keys, Index=0, Wrap=False)

dot_display_2 = DotDisplay(Point=merge_4, Colour=RGB(194, 194, 194), Size=expr("X/2", list_item_14))
length_5 = Length(Curve=line_sdl_14)
sort_list_5 = SortList(Keys=length_5, ValuesValuesA=line_sdl_14)  # -> reverse(Keys), reverse(ValuesValuesA)
list_item_15 = ListItem(List=sort_list_5.ValuesValuesA, Index=0, Wrap=False)
panel_45 = Panel(list_item_15)

number_slider_24 = Slider(29, range=0..256)
number_19 = Number(number)
curve_27 = Curve(curve_23)  # disabled
divide_curve_16 = DivideCurve(Curve=curve_27, Count=number_19, Kinks=False)  # -> Points, Tangents, Parameters
curvature_16 = Curvature(Curve=curve_27, Parameter=divide_curve_16.Parameters)  # -> Point, Curvature, Curvature_2
deconstruct_arc_16 = DeconstructArc(Arc=curvature_16.Curvature_2)  # -> BasePlane, Radius, Angle
line_15 = Line(StartPoint=curvature_16.Point, EndPoint=deconstruct_arc_16.BasePlane)
one_over_x_17 = OneOverX(Value=deconstruct_arc_16.Radius)

derivatives_3 = Derivatives(Curve=curve_27, Parameter=divide_curve_16.Parameters)  # -> Point, FirstDerivative, SecondDerivative, ThirdDerivative, FourthDerivative, FifthDerivative, SixthDerivative
relative_differences_22 = RelativeDifferences(Values=one_over_x_17)
point_6 = Point(curvature_16.Point)

relative_differences_23 = RelativeDifferences(Values=relative_differences_22)
quick_graph_26 = QuickGraph(relative_differences_22, SortOrder=0)
multiplication_12 = Multiplication(A=relative_differences_22, B=digit_scroller_8)
line_sdl_17 = LineSDL(Start=point_6, Direction=line_15, Length=expr("-ABS(X)", multiplication_12))
evaluate_length_24 = EvaluateLength(Curve=line_sdl_17, Length=1, Normalized=True)  # -> Point, Tangent, Parameter
interpolate_19 = Interpolate(Vertices=evaluate_length_24.Point, Degree=3, Periodic=False, KnotStyle=2)  # -> Curve, Length, Domain
panel_46 = Panel(relative_differences_22)

length_6 = Length(Curve=line_sdl_17)
sort_list_6 = SortList(Keys=length_6, ValuesValuesA=line_sdl_17)  # -> reverse(Keys), reverse(ValuesValuesA)
nurbs_curve_14 = NurbsCurve(Vertices=evaluate_length_24.Point, Degree=11, Periodic=False)  # -> Curve, Length, Domain
list_item_16 = ListItem(List=sort_list_6.ValuesValuesA, Index=0, Wrap=False)
panel_47 = Panel(list_item_16)
division_10 = Division(A=sort_list_6.Keys, B=sort_list_5.Keys)
panel_48 = Panel(division_10)
custom_preview_14 = CustomPreview(Geometry=line_sdl_17, Material=create_material)

panel_50 = Panel("""16                
32                
64                
128              
256              0.00191294160505""")
division_11 = Division(A=0.4964279019, B=0.122908661)
curve_28 = Curve(scale_3.Geometry)
evaluate_length_25 = EvaluateLength(Curve=curve_10, Length=0, Normalized=True)  # -> Point, Tangent, Parameter
vector_2pt_6 = Vector2Pt(PointA=Point(0, 0, 0), PointB=evaluate_length_25.Point, Unitize=False)  # -> Vector, Length
create_material_21 = CreateMaterial(Diffuse=RGB(255, 105, 180), Specular=RGB(255, 255, 255), Emission=RGB(0, 0, 0), Transparency=0, Shine=0)

digit_scroller_22 = DigitScroller(Scroller_Digits=12, Scroller_Prefix="Digit Scroller", Scroller_Radix=1, Scroller_Value=0.0019129416)
radians_4 = Radians(Degrees="0.00191294160505")
series_8 = Series(Start=0, Step=radians_4, Count=number_slider_6)

curve_graph_mapper_3 = CurveGraphMapper(Curves=curve_28, Rectangle=rectangle.Rectangle, Values=series_8, Flip=False, Snap=False, TextSize=1)  # -> Mapped, GraphCurves, GraphPoints, ValueLines, ValuePoints, MappedLines, MappedPoints, Boundary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

turtle_4 = DotNETVBScriptLEGACY(Forward=dup, Left=curve_graph_mapper_3.Mapped)  # -> out, Points; inputs Forward: list, Left: list; same code as turtle
point_7 = Point(turtle_4.Points)
interpolate_20 = Interpolate(Vertices=turtle_4.Points, Degree=3, Periodic=False, KnotStyle=0)  # -> Curve, Length, Domain

evaluate_length_26 = EvaluateLength(Curve=interpolate_20.Curve, Length=1, Normalized=True)  # -> Point, Tangent, Parameter
line_sdl_18 = LineSDL(Start=evaluate_length_26.Point, Direction=evaluate_length_26.Tangent, Length=1)
mirror_11 = Mirror(Geometry=interpolate_20.Curve, Plane=line_sdl_18)  # -> Geometry, Transform
join_curves_8 = JoinCurves(Curves=[interpolate_20.Curve, mirror_11.Geometry], Preserve=False)
end_points_4 = EndPoints(Curve=join_curves_8)  # -> Start, End
line_16 = Line(StartPoint=end_points_4.Start, EndPoint=end_points_4.End)
angle_9 = Angle(VectorA=Vector(1.4375, 0, 0), VectorB=line_16)  # -> Angle, Reflex
rotate_9 = Rotate(Geometry=join_curves_8, Angle=expr("-X", angle_9.Angle), Plane=evaluate_length_26.Point)  # -> Geometry, Transform
vector_2pt_7 = Vector2Pt(PointA=evaluate_length_26.Point, PointB=Point(0, 0, 0), Unitize=False)  # -> Vector, Length
move_18 = Move(Geometry=rotate_9.Geometry, Motion=vector_2pt_7.Vector)  # -> Geometry, Transform
curve_domain_4 = CurveDomain(Curve=move_18.Geometry)  # -> Curve, Domain
deconstruct_domain_17 = DeconstructDomain(Domain=curve_domain_4.Domain)  # -> Start, End
construct_domain_5 = ConstructDomain(DomainStart=expr("X/2", deconstruct_domain_17.End), DomainEnd=deconstruct_domain_17.End)
sub_curve_4 = SubCurve(BaseCurve=curve_domain_4.Curve, Domain=construct_domain_5)
evaluate_length_27 = EvaluateLength(Curve=sub_curve_4, Length=1, Normalized=True)  # -> Point, Tangent, Parameter
rotate_10 = Rotate(Geometry=sub_curve_4, Angle=3.141592654, Plane=evaluate_length_27.Point)  # -> Geometry, Transform
join_curves_9 = JoinCurves(Curves=[sub_curve_4, rotate_10.Geometry], Preserve=False)
bounding_box_11 = BoundingBox(Content=join_curves_9, Plane=PlaneXY(0, 0, 0), UnionBox=True)  # -> Box, Box_2
deconstruct_box_10 = DeconstructBox(Box=bounding_box_11.Box)  # -> Plane, X, Y, Z
scale_4 = Scale(Geometry=join_curves_9, Center=Point(0, 0, 0), Factor=expr("X^-1", deconstruct_box_10.X))  # -> Geometry, Transform
mirror_12 = Mirror(Geometry=scale_4.Geometry, Plane=yz_plane)  # -> Geometry, Transform
move_19 = Move(Geometry=mirror_12.Geometry, Motion=vector_2pt_6.Vector)  # -> Geometry, Transform
curve_29 = Curve(move_19.Geometry)
deconstruct_domain_18 = DeconstructDomain(Domain=deconstruct_box_10.X)  # -> Start, End
deconstruct_domain_19 = DeconstructDomain(Domain=deconstruct_box_10.Y)  # -> Start, End
custom_preview_15 = CustomPreview(Geometry=curve_29, Material=create_material_21)
division_12 = Division(A=deconstruct_domain_18.End, B=deconstruct_domain_19.End)
panel_54 = Panel(division_12)

number_slider_25 = Slider(40, range=0..256)
curve_30 = Curve(curve_29)
number_20 = Number(number)
divide_curve_17 = DivideCurve(Curve=curve_30, Count=number_20, Kinks=False)  # -> Points, Tangents, Parameters
curvature_17 = Curvature(Curve=curve_30, Parameter=divide_curve_17.Parameters)  # -> Point, Curvature, Curvature_2
deconstruct_arc_17 = DeconstructArc(Arc=curvature_17.Curvature_2)  # -> BasePlane, Radius, Angle
line_17 = Line(StartPoint=curvature_17.Point, EndPoint=deconstruct_arc_17.BasePlane)
one_over_x_18 = OneOverX(Value=deconstruct_arc_17.Radius)
panel_55 = Panel(one_over_x_18)
quick_graph_27 = QuickGraph(one_over_x_18, SortOrder=0)
multiplication_13 = Multiplication(A=one_over_x_18, B=Slider(0.088888, range=0..0.5))
line_sdl_19 = LineSDL(Start=curvature_17.Point, Direction=line_17, Length=expr("-ABS(X)", multiplication_13))
evaluate_length_28 = EvaluateLength(Curve=line_sdl_19, Length=1, Normalized=True)  # -> Point, Tangent, Parameter
interpolate_21 = Interpolate(Vertices=evaluate_length_28.Point, Degree=3, Periodic=False, KnotStyle=2)  # -> Curve, Length, Domain
create_material_22 = CreateMaterial(Diffuse=RGB(232, 232, 232), Specular=RGB(0, 255, 255), Emission=RGB(0, 0, 0), Transparency=0.5, Shine=100)
create_material_23 = CreateMaterial(Diffuse=RGB(222, 222, 222), Specular=RGB(0, 255, 255), Emission=RGB(0, 0, 0), Transparency=0.5, Shine=100)
create_material_24 = CreateMaterial(Diffuse=RGB(199, 199, 199), Specular=RGB(0, 255, 255), Emission=RGB(0, 0, 0), Transparency=0.5, Shine=100)
custom_preview_16 = CustomPreview(Geometry=curve_30, Material=create_material_24)
custom_preview_17 = CustomPreview(Geometry=line_sdl_19, Material=create_material_22)
custom_preview_18 = CustomPreview(Geometry=interpolate_21.Curve, Material=create_material_23)

relative_differences_24 = RelativeDifferences(Values=one_over_x_18)

create_material_25 = CreateMaterial(Diffuse=RGB(235, 235, 235), Specular=RGB(0, 255, 255), Emission=RGB(0, 0, 0), Transparency=0.5, Shine=100)
derivatives_4 = Derivatives(Curve=curve_30, Parameter=divide_curve_17.Parameters)  # -> Point, FirstDerivative, SecondDerivative, ThirdDerivative, FourthDerivative, FifthDerivative, SixthDerivative
panel_56 = Panel(relative_differences_24)
number_slider_26 = Slider(42, range=0..256)
quick_graph_28 = QuickGraph(relative_differences_24, SortOrder=0)
multiplication_14 = Multiplication(A=relative_differences_24, B=digit_scroller_9)
line_sdl_20 = LineSDL(Start=evaluate_length_28.Point, Direction=derivatives_4.SecondDerivative, Length=expr("-ABS(X)", multiplication_14))
evaluate_length_29 = EvaluateLength(Curve=line_sdl_20, Length=1, Normalized=True)  # -> Point, Tangent, Parameter
line_sdl_21 = LineSDL(Start=evaluate_length_29.Point, Direction=derivatives_4.ThirdDerivative, Length=expr("-X", multiplication_14))
custom_preview_19 = CustomPreview(Geometry=line_sdl_21, Material=create_material_25)
interpolate_22 = Interpolate(Vertices=evaluate_length_29.Point, Degree=3, Periodic=False, KnotStyle=2)  # -> Curve, Length, Domain
curve_31 = Curve(interpolate_21.Curve)
number_21 = Number(number)
divide_curve_18 = DivideCurve(Curve=curve_31, Count=number_21, Kinks=False)  # -> Points, Tangents, Parameters
curvature_18 = Curvature(Curve=curve_31, Parameter=divide_curve_18.Parameters)  # -> Point, Curvature, Curvature_2
deconstruct_arc_18 = DeconstructArc(Arc=curvature_18.Curvature_2)  # -> BasePlane, Radius, Angle
one_over_x_19 = OneOverX(Value=deconstruct_arc_18.Radius)
line_18 = Line(StartPoint=curvature_18.Point, EndPoint=deconstruct_arc_18.BasePlane)
create_material_26 = CreateMaterial(Diffuse=RGB(224, 224, 224), Specular=RGB(0, 255, 255), Emission=RGB(0, 0, 0), Transparency=0.5, Shine=100)
create_material_27 = CreateMaterial(Diffuse=RGB(242, 242, 242), Specular=RGB(0, 255, 255), Emission=RGB(0, 0, 0), Transparency=0.5, Shine=100)
custom_preview_20 = CustomPreview(Geometry=interpolate_22.Curve, Material=create_material_26)
custom_preview_21 = CustomPreview(Geometry=line_sdl_20, Material=create_material_27)

evaluate_length_30 = EvaluateLength(Curve=line_sdl_21, Length=1, Normalized=True)  # -> Point, Tangent, Parameter
interpolate_23 = Interpolate(Vertices=evaluate_length_30.Point, Degree=3, Periodic=False, KnotStyle=2)  # -> Curve, Length, Domain
nurbs_curve_15 = NurbsCurve(Vertices=evaluate_length_30.Point, Degree=11, Periodic=False)  # -> Curve, Length, Domain
nurbs_curve_16 = NurbsCurve(Vertices=evaluate_length_29.Point, Degree=11, Periodic=False)  # -> Curve, Length, Domain
nurbs_curve_17 = NurbsCurve(Vertices=evaluate_length_28.Point, Degree=11, Periodic=False)  # -> Curve, Length, Domain

evaluate_length_31 = EvaluateLength(Curve=move_19.Geometry, Length=1, Normalized=True)  # -> Point, Tangent, Parameter

yz_plane_3 = YZPlane(Origin=evaluate_length_31.Point)

curve_32 = Curve(curve_23)
mirror_13 = Mirror(Geometry=curve_32, Plane=yz_plane_3)  # -> Geometry, Transform
scale_nu_5 = ScaleNU(Geometry=[curve_32, mirror_13.Geometry], Plane=PlaneXY(0, 0, 0), ScaleX=0.5, ScaleY=expr("-X", 0.5), ScaleZ=1)  # -> Geometry, Transform
move_20 = Move(Geometry=scale_nu_5.Geometry, Motion=Vector(2, -0.5, 0))  # -> Geometry, Transform

curve_33 = Curve(graft([curve_7, move_10.Geometry, move_20.Geometry]))
divide_curve_19 = DivideCurve(Curve=curve_33, Count=number_8, Kinks=False)  # -> Points, Tangents, Parameters
curvature_19 = Curvature(Curve=curve_33, Parameter=divide_curve_19.Parameters)  # -> Point, Curvature, Curvature_2
deconstruct_arc_19 = DeconstructArc(Arc=curvature_19.Curvature_2)  # -> BasePlane, Radius, Angle
line_19 = Line(StartPoint=curvature_19.Point, EndPoint=deconstruct_arc_19.BasePlane)
one_over_x_20 = OneOverX(Value=deconstruct_arc_19.Radius)
panel_57 = Panel(one_over_x_20)
quick_graph_29 = QuickGraph(one_over_x_20, SortOrder=0)
multiplication_15 = Multiplication(A=one_over_x_20, B=Slider(0.015666, range=0..0.5))
line_sdl_22 = LineSDL(Start=curvature_19.Point, Direction=line_19, Length=expr("-ABS(X)", multiplication_15))
evaluate_length_32 = EvaluateLength(Curve=line_sdl_22, Length=1, Normalized=True)  # -> Point, Tangent, Parameter
interpolate_24 = Interpolate(Vertices=evaluate_length_32.Point, Degree=3, Periodic=False, KnotStyle=2)  # -> Curve, Length, Domain
custom_preview_22 = CustomPreview(Geometry=line_sdl_22, Material=create_material_5)
custom_preview_23 = CustomPreview(Geometry=interpolate_24.Curve, Material=create_material_6)
custom_preview_24 = CustomPreview(Geometry=[curve_33, curve_6], Material=create_material_7)

relative_differences_25 = RelativeDifferences(Values=one_over_x_20)

panel_58 = Panel(relative_differences_25)
derivatives_5 = Derivatives(Curve=curve_33, Parameter=divide_curve_19.Parameters)  # -> Point, FirstDerivative, SecondDerivative, ThirdDerivative, FourthDerivative, FifthDerivative, SixthDerivative
quick_graph_30 = QuickGraph(relative_differences_25, SortOrder=0)
multiplication_16 = Multiplication(A=relative_differences_25, B=digit_scroller_3)
line_sdl_23 = LineSDL(Start=evaluate_length_32.Point, Direction=line_19, Length=expr("-ABS(X)", multiplication_16))
evaluate_length_33 = EvaluateLength(Curve=line_sdl_23, Length=1, Normalized=True)  # -> Point, Tangent, Parameter
line_sdl_24 = LineSDL(Start=evaluate_length_33.Point, Direction=derivatives_5.ThirdDerivative, Length=expr("-X", multiplication_16))
custom_preview_25 = CustomPreview(Geometry=line_sdl_24, Material=create_material_2)
interpolate_25 = Interpolate(Vertices=evaluate_length_33.Point, Degree=3, Periodic=False, KnotStyle=2)  # -> Curve, Length, Domain
curve_34 = Curve(interpolate_24.Curve)
divide_curve_20 = DivideCurve(Curve=curve_34, Count=number_7, Kinks=False)  # -> Points, Tangents, Parameters
curvature_20 = Curvature(Curve=curve_34, Parameter=divide_curve_20.Parameters)  # -> Point, Curvature, Curvature_2
deconstruct_arc_20 = DeconstructArc(Arc=curvature_20.Curvature_2)  # -> BasePlane, Radius, Angle
one_over_x_21 = OneOverX(Value=deconstruct_arc_20.Radius)
line_20 = Line(StartPoint=curvature_20.Point, EndPoint=deconstruct_arc_20.BasePlane)
custom_preview_26 = CustomPreview(Geometry=interpolate_25.Curve, Material=create_material_3)
custom_preview_27 = CustomPreview(Geometry=line_sdl_23, Material=create_material_4)

nurbs_curve_18 = NurbsCurve(Vertices=evaluate_length_33.Point, Degree=11, Periodic=False)  # -> Curve, Length, Domain
nurbs_curve_19 = NurbsCurve(Vertices=evaluate_length_32.Point, Degree=11, Periodic=False)  # -> Curve, Length, Domain

polyline_7 = PolyLine(Vertices=curvature_19.Point, Closed=False)
explode_7 = Explode(Curve=polyline_7, Recursive=True)  # -> Segments, Vertices
curve_35 = Curve(flatten(explode_7.Segments))
length_7 = Length(Curve=curve_35)
sort_list_7 = SortList(Keys=length_7, ValuesValuesA=curve_35)  # -> Keys, ValuesValuesA
panel_59 = Panel(sort_list_7.Keys)
list_item_17 = ListItem(List=sort_list_7.Keys, Index=0, Wrap=False)

dot_display_3 = DotDisplay(Point=evaluate_length_33.Point, Colour=RGB(194, 194, 194), Size=expr("X/2", list_item_17))
merge_5 = Merge(Data1=evaluate_length_29.Point)

polyline_8 = PolyLine(Vertices=curvature_17.Point, Closed=False)
explode_8 = Explode(Curve=polyline_8, Recursive=True)  # -> Segments, Vertices
curve_36 = Curve(flatten(explode_8.Segments))
length_8 = Length(Curve=curve_36)
sort_list_8 = SortList(Keys=length_8, ValuesValuesA=curve_36)  # -> Keys, ValuesValuesA
panel_60 = Panel(sort_list_8.Keys)
list_item_18 = ListItem(List=sort_list_8.Keys, Index=0, Wrap=False)

dot_display_4 = DotDisplay(Point=merge_5, Colour=RGB(194, 194, 194), Size=expr("X/2", list_item_18))

merge_6 = Merge(Data1=line_sdl_7, Data2=line_sdl_16, Data3=line_sdl_24)
bounding_box_12 = BoundingBox(Content=flatten(merge_6), Plane=PlaneXY(0, 0, 0), UnionBox=True)  # -> Box, Box_2

panel_61 = Panel("""16                
32                
64                
128              
256              0.0019129629683""")
division_13 = Division(A=0.4964279019, B=0.122908661)
curve_37 = Curve(scale_4.Geometry)
evaluate_length_34 = EvaluateLength(Curve=curve_29, Length=0, Normalized=True)  # -> Point, Tangent, Parameter
yz_plane_4 = YZPlane(Origin=evaluate_length_34.Point)
vector_2pt_8 = Vector2Pt(PointA=Point(0, 0, 0), PointB=evaluate_length_34.Point, Unitize=False)  # -> Vector, Length
create_material_28 = CreateMaterial(Diffuse=RGB(255, 105, 180), Specular=RGB(255, 255, 255), Emission=RGB(0, 0, 0), Transparency=0, Shine=0)

digit_scroller_23 = DigitScroller(Scroller_Digits=12, Scroller_Prefix="Digit Scroller", Scroller_Radix=1, Scroller_Value=0.00191296296)
radians_5 = Radians(Degrees="0.0019129629683")
series_9 = Series(Start=0, Step=radians_5, Count=number_slider_6)

curve_graph_mapper_4 = CurveGraphMapper(Curves=curve_37, Rectangle=rectangle.Rectangle, Values=series_9, Flip=False, Snap=False, TextSize=1)  # -> Mapped, GraphCurves, GraphPoints, ValueLines, ValuePoints, MappedLines, MappedPoints, Boundary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

turtle_5 = DotNETVBScriptLEGACY(Forward=dup, Left=curve_graph_mapper_4.Mapped)  # -> out, Points; inputs Forward: list, Left: list; disabled; same code as turtle
point_8 = Point(turtle_5.Points)
interpolate_26 = Interpolate(Vertices=turtle_5.Points, Degree=3, Periodic=False, KnotStyle=0)  # -> Curve, Length, Domain

evaluate_length_35 = EvaluateLength(Curve=interpolate_26.Curve, Length=1, Normalized=True)  # -> Point, Tangent, Parameter
line_sdl_25 = LineSDL(Start=evaluate_length_35.Point, Direction=evaluate_length_35.Tangent, Length=1)
mirror_14 = Mirror(Geometry=interpolate_26.Curve, Plane=line_sdl_25)  # -> Geometry, Transform
join_curves_10 = JoinCurves(Curves=[interpolate_26.Curve, mirror_14.Geometry], Preserve=False)
end_points_5 = EndPoints(Curve=join_curves_10)  # -> Start, End
line_21 = Line(StartPoint=end_points_5.Start, EndPoint=end_points_5.End)
angle_10 = Angle(VectorA=Vector(1.4375, 0, 0), VectorB=line_21)  # -> Angle, Reflex
rotate_11 = Rotate(Geometry=join_curves_10, Angle=expr("-X", angle_10.Angle), Plane=evaluate_length_35.Point)  # -> Geometry, Transform
vector_2pt_9 = Vector2Pt(PointA=evaluate_length_35.Point, PointB=Point(0, 0, 0), Unitize=False)  # -> Vector, Length
move_21 = Move(Geometry=rotate_11.Geometry, Motion=vector_2pt_9.Vector)  # -> Geometry, Transform
curve_domain_5 = CurveDomain(Curve=move_21.Geometry)  # -> Curve, Domain
deconstruct_domain_20 = DeconstructDomain(Domain=curve_domain_5.Domain)  # -> Start, End
construct_domain_6 = ConstructDomain(DomainStart=expr("X/2", deconstruct_domain_20.End), DomainEnd=deconstruct_domain_20.End)
sub_curve_5 = SubCurve(BaseCurve=curve_domain_5.Curve, Domain=construct_domain_6)
evaluate_length_36 = EvaluateLength(Curve=sub_curve_5, Length=1, Normalized=True)  # -> Point, Tangent, Parameter
rotate_12 = Rotate(Geometry=sub_curve_5, Angle=3.141592654, Plane=evaluate_length_36.Point)  # -> Geometry, Transform
join_curves_11 = JoinCurves(Curves=[sub_curve_5, rotate_12.Geometry], Preserve=False)
bounding_box_13 = BoundingBox(Content=join_curves_11, Plane=PlaneXY(0, 0, 0), UnionBox=True)  # -> Box, Box_2
deconstruct_box_11 = DeconstructBox(Box=bounding_box_13.Box)  # -> Plane, X, Y, Z
scale_5 = Scale(Geometry=join_curves_11, Center=Point(0, 0, 0), Factor=expr("X^-1", deconstruct_box_11.X))  # -> Geometry, Transform
mirror_15 = Mirror(Geometry=scale_5.Geometry, Plane=yz_plane)  # -> Geometry, Transform
move_22 = Move(Geometry=scale_5.Geometry, Motion=vector_2pt_8.Vector)  # -> Geometry, Transform
curve_38 = Curve(move_22.Geometry)
deconstruct_domain_21 = DeconstructDomain(Domain=deconstruct_box_11.X)  # -> Start, End
deconstruct_domain_22 = DeconstructDomain(Domain=deconstruct_box_11.Y)  # -> Start, End
custom_preview_28 = CustomPreview(Geometry=curve_38, Material=create_material_28)
division_14 = Division(A=deconstruct_domain_21.End, B=deconstruct_domain_22.End)
panel_65 = Panel(division_14)

number_slider_27 = Slider(40, range=0..256)
curve_39 = Curve(curve_38)  # disabled
number_22 = Number(number)
divide_curve_21 = DivideCurve(Curve=curve_39, Count=number_22, Kinks=False)  # -> Points, Tangents, Parameters
curvature_21 = Curvature(Curve=curve_39, Parameter=divide_curve_21.Parameters)  # -> Point, Curvature, Curvature_2
deconstruct_arc_21 = DeconstructArc(Arc=curvature_21.Curvature_2)  # -> BasePlane, Radius, Angle
line_22 = Line(StartPoint=curvature_21.Point, EndPoint=deconstruct_arc_21.BasePlane)
one_over_x_22 = OneOverX(Value=deconstruct_arc_21.Radius)
panel_66 = Panel(one_over_x_22)
quick_graph_31 = QuickGraph(one_over_x_22, SortOrder=0)
multiplication_17 = Multiplication(A=one_over_x_22, B=Slider(0.088888, range=0..0.5))
line_sdl_26 = LineSDL(Start=curvature_21.Point, Direction=line_22, Length=expr("-ABS(X)", multiplication_17))
evaluate_length_37 = EvaluateLength(Curve=line_sdl_26, Length=1, Normalized=True)  # -> Point, Tangent, Parameter
interpolate_27 = Interpolate(Vertices=evaluate_length_37.Point, Degree=3, Periodic=False, KnotStyle=2)  # -> Curve, Length, Domain
create_material_29 = CreateMaterial(Diffuse=RGB(232, 232, 232), Specular=RGB(0, 255, 255), Emission=RGB(0, 0, 0), Transparency=0.5, Shine=100)
create_material_30 = CreateMaterial(Diffuse=RGB(222, 222, 222), Specular=RGB(0, 255, 255), Emission=RGB(0, 0, 0), Transparency=0.5, Shine=100)
create_material_31 = CreateMaterial(Diffuse=RGB(199, 199, 199), Specular=RGB(0, 255, 255), Emission=RGB(0, 0, 0), Transparency=0.5, Shine=100)
custom_preview_29 = CustomPreview(Geometry=curve_39, Material=create_material_31)
custom_preview_30 = CustomPreview(Geometry=line_sdl_26, Material=create_material_29)
custom_preview_31 = CustomPreview(Geometry=interpolate_27.Curve, Material=create_material_30)

relative_differences_26 = RelativeDifferences(Values=one_over_x_22)

create_material_32 = CreateMaterial(Diffuse=RGB(235, 235, 235), Specular=RGB(0, 255, 255), Emission=RGB(0, 0, 0), Transparency=0.5, Shine=100)
derivatives_6 = Derivatives(Curve=curve_39, Parameter=divide_curve_21.Parameters)  # -> Point, FirstDerivative, SecondDerivative, ThirdDerivative, FourthDerivative, FifthDerivative, SixthDerivative
panel_67 = Panel(relative_differences_26)
number_slider_28 = Slider(42, range=0..256)
quick_graph_32 = QuickGraph(relative_differences_26, SortOrder=0)
multiplication_18 = Multiplication(A=relative_differences_26, B=digit_scroller_10)
line_sdl_27 = LineSDL(Start=evaluate_length_37.Point, Direction=derivatives_6.SecondDerivative, Length=expr("-ABS(X)", multiplication_18))
evaluate_length_38 = EvaluateLength(Curve=line_sdl_27, Length=1, Normalized=True)  # -> Point, Tangent, Parameter
line_sdl_28 = LineSDL(Start=evaluate_length_38.Point, Direction=derivatives_6.ThirdDerivative, Length=expr("-X", multiplication_18))
custom_preview_32 = CustomPreview(Geometry=line_sdl_28, Material=create_material_32)
interpolate_28 = Interpolate(Vertices=evaluate_length_38.Point, Degree=3, Periodic=False, KnotStyle=2)  # -> Curve, Length, Domain
curve_40 = Curve(interpolate_27.Curve)
number_23 = Number(number)
divide_curve_22 = DivideCurve(Curve=curve_40, Count=number_23, Kinks=False)  # -> Points, Tangents, Parameters
curvature_22 = Curvature(Curve=curve_40, Parameter=divide_curve_22.Parameters)  # -> Point, Curvature, Curvature_2
deconstruct_arc_22 = DeconstructArc(Arc=curvature_22.Curvature_2)  # -> BasePlane, Radius, Angle
one_over_x_23 = OneOverX(Value=deconstruct_arc_22.Radius)
line_23 = Line(StartPoint=curvature_22.Point, EndPoint=deconstruct_arc_22.BasePlane)
create_material_33 = CreateMaterial(Diffuse=RGB(230, 230, 230), Specular=RGB(0, 255, 255), Emission=RGB(0, 0, 0), Transparency=0.5, Shine=100)
create_material_34 = CreateMaterial(Diffuse=RGB(242, 242, 242), Specular=RGB(0, 255, 255), Emission=RGB(0, 0, 0), Transparency=0.5, Shine=100)
custom_preview_33 = CustomPreview(Geometry=interpolate_28.Curve, Material=create_material_33)
custom_preview_34 = CustomPreview(Geometry=line_sdl_27, Material=create_material_34)

evaluate_length_39 = EvaluateLength(Curve=line_sdl_28, Length=1, Normalized=True)  # -> Point, Tangent, Parameter
interpolate_29 = Interpolate(Vertices=evaluate_length_39.Point, Degree=3, Periodic=False, KnotStyle=2)  # -> Curve, Length, Domain
nurbs_curve_20 = NurbsCurve(Vertices=evaluate_length_39.Point, Degree=11, Periodic=False)  # -> Curve, Length, Domain
nurbs_curve_21 = NurbsCurve(Vertices=evaluate_length_38.Point, Degree=11, Periodic=False)  # -> Curve, Length, Domain
nurbs_curve_22 = NurbsCurve(Vertices=evaluate_length_37.Point, Degree=11, Periodic=False)  # -> Curve, Length, Domain
merge_7 = Merge(Data1=evaluate_length_38.Point)

polyline_9 = PolyLine(Vertices=curvature_21.Point, Closed=False)
explode_9 = Explode(Curve=polyline_9, Recursive=True)  # -> Segments, Vertices
curve_41 = Curve(flatten(explode_9.Segments))
length_9 = Length(Curve=curve_41)
sort_list_9 = SortList(Keys=length_9, ValuesValuesA=curve_41)  # -> Keys, ValuesValuesA
panel_68 = Panel(sort_list_9.Keys)
list_item_19 = ListItem(List=sort_list_9.Keys, Index=0, Wrap=False)

dot_display_5 = DotDisplay(Point=merge_7, Colour=RGB(194, 194, 194), Size=expr("X/2", list_item_19))
