# Grasshopper definition XHG.......ⵙ∷ⵙ꞉ⵙⵔⵙ·ⵙ⊚ⵙ꞉ⵙ◯ⵙᗱᗴⵙᗯⵙᴥⵙᑎⵙᑐᑕⵙ◯ⵙИNⵙⓄⵙꖴⵙ✤ⵙꖴⵙᔓᔕⵙИNⵙᗩⵙᴥⵙ✤ⵙ◯ⵙꗳⵙᙁⵙᗱᗴⵙᔓᔕⵙ◯ⵙᙁⵙᗩⵙᗱᗴⵙᗝⵙꖴⵙ⊚ⵙ◌ⵙ⊚ⵙ◌ⵙ⊚ⵙ◌ⵙ⚪ⵙ◯ⵙ◯ⵙ⚪ⵙ◌ⵙ⊚ⵙ◌ⵙ⊚ⵙ◌ⵙ⊚ⵙꖴⵙᗝⵙᗱᗴⵙᗩⵙᙁⵙ◯ⵙᔓᔕⵙᗱᗴⵙᙁⵙꗳⵙ◯ⵙ✤ⵙᴥⵙᗩⵙИNⵙᔓᔕⵙꖴⵙ✤ⵙꖴⵙⓄⵙИNⵙ◯ⵙᑐᑕⵙᑎⵙᴥⵙᗯⵙᗱᗴⵙ◯ⵙ꞉ⵙ⊚ⵙ·ⵙⵔⵙ꞉ⵙ∷ⵙ.......GHX (Grasshopper 1.0.7)
# Copyright: © 2017-2022 Pierre Cuvilliers, Caitlin Mueller, Massachusetts Institute of Technology
# plug-ins: Palette, Heteroptera, Anemone, Pufferfish

digit_scroller = DigitScroller(Scroller_Digits=12, Scroller_Prefix=" ", Scroller_Radix=11, Scroller_Value=5)  # disabled
increase_bend_per_segment = DigitScroller(Scroller_Digits=12, Scroller_Prefix="INCREASE BEND PER SEGMENT", Scroller_Radix=2, Scroller_Value=5)  # disabled
sement_length = DigitScroller(Scroller_Digits=12, Scroller_Prefix="SEMENT LENGTH", Scroller_Radix=2, Scroller_Value=0.0737955968)  # disabled

panel = Panel("np.diff(x)")  # disabled
panel_2 = Panel("C:\O\O_ERAWTFOS_O_SOFTWARE_O\O_SMARGORP_O_PROGRAMS_O\O_GNIMARGORP_O_PROGRAMING_O\O_NOHTYP_O_PYTHON_O\O_81_7_2_O_2_7_18_O\")  # disabled
panel_3 = Panel("""numpy
scipy""")  # disabled
ghpython_script = GhPythonScript(x=[4, 16, 256], y=panel)  # -> out, a; inputs x: list, y: list; disabled
# ---------- ghpython_script: Python ----------
import rhinoscriptsyntax as rs
import scriptcontext as sc
import ghpythonremote
from ghpythonlib.treehelpers import list_to_tree # Rhino 6 only!
np = sc.sticky['numpy'];
sp = sc.sticky['scipy'];
a = np.diff(x);
a = ghpythonremote.obtain(a.tolist());
a = list_to_tree(a, source=[0,0]);
# ---------- end ghpython_script ----------
panel_4 = Panel(ghpython_script.out)  # disabled
panel_5 = Panel(ghpython_script.a)  # disabled
gh_python_remote = GHPythonRemote(location=panel_2, run=True, modules=panel_3)  # -> out, linked_modules, rpy, import_statements; disabled
panel_6 = Panel(gh_python_remote.out)  # disabled
panel_7 = Panel(gh_python_remote.linked_modules)  # disabled
panel_8 = Panel(gh_python_remote.rpy)  # disabled
panel_9 = Panel(gh_python_remote.import_statements)  # disabled

colour_swatch = ColourSwatch(SwatchColor=RGB(255, 255, 255))
colour_swatch_2 = ColourSwatch(SwatchColor=RGB(227, 227, 227))
colour_swatch_3 = ColourSwatch(SwatchColor=RGB(115, 115, 115))
colour_swatch_4 = ColourSwatch(SwatchColor=RGB(209, 209, 209))
colour_swatch_5 = ColourSwatch(SwatchColor=RGB(222, 222, 222))
colour_swatch_6 = ColourSwatch(SwatchColor=RGB(168, 168, 168))
palette = Palette(
    ModeCustomStandard=True,
    Component_Normal_Deselected_Fill_Color=colour_swatch,
    Component_Normal_Deselected_Edge_Color=colour_swatch_4,
    Component_Normal_Deselected_Text_Color=colour_swatch_3,
    Component_Normal_Selected_Fill_Color=colour_swatch_2,
    Component_Normal_Selected_Edge_Color=colour_swatch_4,
    Component_Normal_Selected_Text_Color=colour_swatch_3,
    Component_Hidden_Deselected_Fill_Color=colour_swatch,
    Component_Hidden_Deselected_Edge_Color=colour_swatch_4,
    Component_Hidden_Deselected_Text_Color=colour_swatch_3,
    Component_Hidden_Selected_Fill_Color=colour_swatch_2,
    Component_Hidden_Selected_Edge_Color=colour_swatch_4,
    Component_Hidden_Selected_Text_Color=colour_swatch_3,
    Component_Disabled_Deselected_Fill_Color=ColourSwatch(SwatchColor=RGB(196, 196, 196)),
    Component_Disabled_Deselected_Edge_Color=colour_swatch_4,
    Component_Disabled_Deselected_Text_Color=colour_swatch_3,
    Component_Disabled_Selected_Fill_Color=ColourSwatch(SwatchColor=RGB(176, 176, 176)),
    Component_Disabled_Selected_Edge_Color=colour_swatch_4,
    Component_Disabled_Selected_Text_Color=colour_swatch_3,
    Component_Warning_Deselected_Fill_Color=colour_swatch,
    Component_Warning_Deselected_Edge_Color=colour_swatch_4,
    Component_Warning_Deselected_Text_Color=colour_swatch_3,
    Component_Warning_Selected_Fill_Color=colour_swatch_2,
    Component_Warning_Selected_Edge_Color=colour_swatch_4,
    Component_Warning_Selected_Text_Color=colour_swatch_3,
    Component_Error_Deselected_Fill_Color=colour_swatch,
    Component_Error_Deselected_Edge_Color=colour_swatch_4,
    Component_Error_Deselected_Text_Color=colour_swatch_3,
    Component_Error_Selected_Fill_Color=RGB(255, 255, 255),
    Component_Error_Selected_Edge_Color=colour_swatch_4,
    Component_Error_Selected_Text_Color=colour_swatch_3,
    Component_Label_Deselected_Fill_Color=RGB(50, 50, 50),
    Component_Label_Deselected_Edge_Color=colour_swatch_4,
    Component_Label_Deselected_Text_Color=colour_swatch_3,
    Component_Label_Selected_Fill_Color=RGB(25, 60, 25),
    Component_Label_Selected_Edge_Color=colour_swatch_4,
    Component_Label_Selected_Text_Color=colour_swatch_3,
    Galapagos_Deselected_Fill_Color=RGB(252, 252, 252),
    Galapagos_Deselected_Edge_Color=colour_swatch_4,
    Galapagos_Selected_Fill_Color=RGB(255, 255, 255),
    Galapagos_Selected_Edge_Color=colour_swatch_4,
    Wire_Normal_Color=colour_swatch_5,
    Wire_Empty_Color=colour_swatch_5,
    Wire_Selected_Start_Color=colour_swatch_6,
    Wire_Selected_End_Color=colour_swatch_6,
    Panel_Default_Color=RGB(255, 255, 255),
    Group_Default_Color=RGB(255, 255, 255),
    Canvas_Background_Color=RGB(255, 255, 255),
    Canvas_Gridline_Color=RGB(240, 240, 240),
    Canvas_Gridline_Width=2,
    Canvas_Gridline_Height=2,
    Canvas_Edge_Color=RGB(207, 207, 207),
    Canvas_Shadow_Color=RGBA(237, 237, 237, 0),
    Canvas_Shadow_Size=2,
    MonochromaticOnOff=False,
    Monochromatic_Color=RGB(255, 255, 255))
infoglasses = InfoGlasses(
    Run=True,
    Language=0,
    BackGroundColor=RGB(255, 255, 255),
    BoundaryColor=RGB(115, 115, 115),
    English=True,
    FullName_Category=True,
    Merge_Box=True,
    TextColor=RGB(59, 59, 59),
    assemBoxWidth=1000,
    assemFontSize=8,
    assemSet=False,
    assemboxHeight=0,
    autoHeight=False,
    avoidPro=True,
    cateSet=False,
    highLightRadius=2,
    nameBoxDistance=1,
    nameBoxFontSize=8,
    showName=False,
    showNickName=False,
    showPlugin=False)  # disabled
create_material = CreateMaterial(Diffuse=RGB(207, 207, 207), Specular=RGB(0, 255, 255), Emission=RGB(0, 0, 0), Transparency=0.5, Shine=100)  # disabled
create_material_2 = CreateMaterial(Diffuse=RGB(232, 232, 232), Specular=RGB(0, 255, 255), Emission=RGB(0, 0, 0), Transparency=0.5, Shine=100)  # disabled
derivatives = Derivatives()  # -> Point, FirstDerivative, SecondDerivative, ThirdDerivative, FourthDerivative, FifthDerivative, SixthDerivative; disabled
line_sdl = LineSDL(Direction=derivatives.ThirdDerivative, Length=expr("-X", 1))  # disabled
evaluate_length = EvaluateLength(Curve=line_sdl, Length=1, Normalized=True)  # -> Point, Tangent, Parameter; disabled
interpolate = Interpolate(Vertices=evaluate_length.Point, Degree=3, Periodic=False, KnotStyle=2)  # -> Curve, Length, Domain; disabled
quick_graph = QuickGraph(derivatives.SixthDerivative, SortOrder=0)  # disabled
quick_graph_2 = QuickGraph(derivatives.FifthDerivative, SortOrder=0)  # disabled
quick_graph_3 = QuickGraph(derivatives.FourthDerivative, SortOrder=0)  # disabled
quick_graph_4 = QuickGraph(derivatives.ThirdDerivative, SortOrder=0)  # disabled
quick_graph_5 = QuickGraph(derivatives.SecondDerivative, SortOrder=0)  # disabled
quick_graph_6 = QuickGraph(derivatives.FirstDerivative, SortOrder=0)  # disabled
quick_graph_7 = QuickGraph(derivatives.Point, SortOrder=0)  # disabled
custom_preview = CustomPreview(Geometry=interpolate.Curve, Material=create_material)  # disabled
custom_preview_2 = CustomPreview(Geometry=line_sdl, Material=create_material_2)  # disabled
point = Point(Point(0, 0, 0))
digit_scroller_2 = DigitScroller(Scroller_Digits=12, Scroller_Prefix="Digit Scroller", Scroller_Radix=11, Scroller_Value=16)
power = DigitScroller(Scroller_Digits=12, Scroller_Prefix="POWER", Scroller_Radix=11, Scroller_Value=64)
power_2 = Power(A="2", B=power)
power_3 = Power(A="2", B=digit_scroller_2)
panel_10 = Panel("12    0.77246531994281165")
panel_11 = Panel("0.87246531994281165")
increase_bend_per_segment_2 = DigitScroller(Scroller_Digits=12, Scroller_Prefix="INCREASE BEND PER SEGMENT", Scroller_Radix=1, Scroller_Value=0.522)
increase_bend_per_segment_3 = DigitScroller(Scroller_Digits=12, Scroller_Prefix="INCREASE BEND PER SEGMENT", Scroller_Radix=1, Scroller_Value=0.77246532)
scale = Scale(Center=point, Factor=expr("1/X", power_3))  # -> Geometry, Transform
panel_12 = Panel("0.5225")
panel_13 = Panel("0.492221738454693386")
number_of_segments = DigitScroller(Scroller_Digits=12, Scroller_Prefix="NUMBER OF SEGMENTS", Scroller_Radix=11, Scroller_Value=1024)

increase_bend_per_segment_4 = DigitScroller(Scroller_Digits=12, Scroller_Prefix="INCREASE BEND PER SEGMENT", Scroller_Radix=1, Scroller_Value=0.5226489535)
add_lop_bend = DigitScroller(Scroller_Digits=12, Scroller_Prefix="ADD LOP BEND", Scroller_Radix=1, Scroller_Value=0)
division = Division(A=number_of_segments, B=2)

one_over_x = OneOverX(Value=division)
unit_z = UnitZ(Factor=one_over_x)  # disabled
multiplication = Multiplication(A=power_2, B=one_over_x)
unit_y = UnitY(Factor=one_over_x)

addition = Addition(A="1", B=division)
addition_2 = Addition(A="1", B=addition)

addition_3 = Addition(A=addition_2, B=digit_scroller)  # disabled
series = Series(Start=0, Step=sement_length, Count=addition_2)  # disabled
one_over_x_2 = OneOverX(Value=series)  # disabled
unit_y_2 = UnitY(Factor=series)  # disabled
series_2 = Series(Start=0, Step=sement_length, Count=addition_3)  # disabled
rotate = Rotate(Vector=unit_y_2, Axis=unit_z, Angle=expr("-X", reverse(series_2)))  # disabled
ᔓᔕ_ᙁ_ᗩ_ᴥ_ᗩ_ᑫᑭ_иn_ᗝ_ᗩ_ᔓᔕ_ᗩ_ᙏ_ᙏ_ᗩ_ᔓᔕ_ᗩ_ᗝ_и = ᔓᔕᙁᗩᴥᗩᑫᑭИNᗝᗩᔓᔕᗩᙏᙏᗩᔓᔕᗩᗝИNᑫᑭᗩᴥᗩᙁᔓᔕ(shift=1, relay=rotate)  # -> relay_2, result; disabled
insert_items = InsertItems(List=ᔓᔕ_ᙁ_ᗩ_ᴥ_ᗩ_ᑫᑭ_иn_ᗝ_ᗩ_ᔓᔕ_ᗩ_ᙏ_ᙏ_ᗩ_ᔓᔕ_ᗩ_ᗝ_и.relay_2, Item="{0,0,0}", Indices=0, Wrap=False)  # disabled
interpolate_2 = Interpolate(Vertices=insert_items, Degree=5, Periodic=False, KnotStyle=2)  # -> Curve, Length, Domain; disabled

evaluate_length_2 = EvaluateLength(Curve=interpolate_2.Curve, Length=1, Normalized=True)  # -> Point, Tangent, Parameter; disabled
rotate_2 = Rotate(Geometry=interpolate_2.Curve, Angle=3.141592654, Plane=evaluate_length_2.Point)  # -> Geometry, Transform; disabled
merge = Merge(Data1=interpolate_2.Curve, Data2=rotate_2.Geometry)  # disabled
join_curves = JoinCurves(Curves=merge, Preserve=False)  # disabled

point_2 = Point(insert_items)  # disabled
panel_14 = Panel("(0.52264895353371794+ 0.52264895353371804)/2")

log_n = LogN(Number=division, Base=2)
panel_15 = Panel("0.51542256311")
expression = Expression(O=panel_14, OO=log_n, Expression="O/4^(OO-4)")
series_3 = Series(Start=0, Step=expression, Count=addition_2)
panel_16 = Panel("""16    0.492221738454693386
32    0.507180224586""")

unit_z_2 = UnitZ(Factor=one_over_x)
sement_length_2 = DigitScroller(Scroller_Digits=12, Scroller_Prefix="SEMENT LENGTH", Scroller_Radix=2, Scroller_Value=0.0023)
increase_bend_per_segment_5 = DigitScroller(Scroller_Digits=12, Scroller_Prefix="INCREASE BEND PER SEGMENT", Scroller_Radix=1, Scroller_Value=0.4922217385)
unit_x = UnitX(Factor=one_over_x)
ᔓᔕ_ᙁ_ᗩ_ᴥ_ᗩ_ᑫᑭ_иn_ᗝ_ᗩ_ᔓᔕ_ᗩ_ᙏ_ᙏ_ᗩ_ᔓᔕ_ᗩ_ᗝ_и_2 = ᔓᔕᙁᗩᴥᗩᑫᑭИNᗝᗩᔓᔕᗩᙏᙏᗩᔓᔕᗩᗝИNᑫᑭᗩᴥᗩᙁᔓᔕ(shift=1, relay=series_3)  # -> relay_2, result
rotate_3 = Rotate(Vector=unit_y, Axis=unit_z_2, Angle=expr("-X", reverse(degrees(ᔓᔕ_ᙁ_ᗩ_ᴥ_ᗩ_ᑫᑭ_иn_ᗝ_ᗩ_ᔓᔕ_ᗩ_ᙏ_ᙏ_ᗩ_ᔓᔕ_ᗩ_ᗝ_и_2.relay_2))))
ᔓᔕ_ᙁ_ᗩ_ᴥ_ᗩ_ᑫᑭ_иn_ᗝ_ᗩ_ᔓᔕ_ᗩ_ᙏ_ᙏ_ᗩ_ᔓᔕ_ᗩ_ᗝ_и_3 = ᔓᔕᙁᗩᴥᗩᑫᑭИNᗝᗩᔓᔕᗩᙏᙏᗩᔓᔕᗩᗝИNᑫᑭᗩᴥᗩᙁᔓᔕ(shift=-1, relay=rotate_3)  # -> relay_2, result
insert_items_2 = InsertItems(List=ᔓᔕ_ᙁ_ᗩ_ᴥ_ᗩ_ᑫᑭ_иn_ᗝ_ᗩ_ᔓᔕ_ᗩ_ᙏ_ᙏ_ᗩ_ᔓᔕ_ᗩ_ᗝ_и_3.relay_2, Item="{0,0,0}", Indices=0, Wrap=False)
interpolate_3 = Interpolate(Vertices=insert_items_2, Degree=3, Periodic=False, KnotStyle=2)  # -> Curve, Length, Domain

scale_2 = Scale(Geometry=insert_items_2, Center=point, Factor=power_3)  # -> Geometry, Transform
interpolate_t = InterpolateT(Vertices=insert_items_2, TangentStart=Vector(0, 0, 0), TangentEnd=Vector(0, 0, 0), KnotStyle=2)  # -> Curve, Length, Domain
format = Format(Format="{0:R}", Culture=127, Data0=rotate_3)
expression_2 = Expression(O=insert_items_2, Expression="FORMAT(\"{0:R}\",O)")  # disabled
format_2 = Format(Format="{0:R}", Culture=127, Data0=insert_items_2)  # disabled
kinky_curve = KinkyCurve(Vertices=insert_items_2, Degree=3, Angle=3.141592654)  # -> Curve, Length, Domain
nurbs_curve = NurbsCurve(Vertices=insert_items_2, Degree=2, Periodic=False)  # -> Curve, Length, Domain

evaluate_length_3 = EvaluateLength(Curve=nurbs_curve.Curve, Length=1, Normalized=True)  # -> Point, Tangent, Parameter
rotate_4 = Rotate(Geometry=nurbs_curve.Curve, Angle=3.141592654, Plane=evaluate_length_3.Point)  # -> Geometry, Transform
merge_2 = Merge(Data1=nurbs_curve.Curve, Data2=rotate_4.Geometry)
join_curves_2 = JoinCurves(Curves=merge_2, Preserve=False)

evaluate_length_4 = EvaluateLength(Curve=join_curves_2, Length=1, Normalized=True)  # -> Point, Tangent, Parameter
angle = Angle(VectorA=evaluate_length_4.Tangent, VectorB=Vector(1, 0, 0))  # -> expr("-DEG(X)", Angle), Reflex
rotate_5 = Rotate(Geometry=join_curves_2, Angle=degrees(angle.Angle), Plane=PlaneXY(0, 0, 0))  # -> Geometry, Transform

evaluate_length_5 = EvaluateLength(Curve=rotate_5.Geometry, Length=1, Normalized=True)  # -> Point, Tangent, Parameter
deconstruct = Deconstruct(Point=evaluate_length_5.Point)  # -> XComponent, YComponent, ZComponent
scale_nu = ScaleNU(
    Geometry=rotate_5.Geometry,
    Plane=PlaneXY(0, 0, 0),
    ScaleX=expr("1/X", deconstruct.XComponent),
    ScaleY=expr("1/X", deconstruct.YComponent),
    ScaleZ=expr("1/X", deconstruct.ZComponent))  # -> Geometry, Transform

deconstruct_2 = Deconstruct(Point=evaluate_length_5.Point)  # -> XComponent, YComponent, ZComponent
format_3 = Format(Format="{0:R}", Culture=127, Data0=deconstruct_2.XComponent)
X = Panel(format_3)
format_4 = Format(Format="{0:R}", Culture=127, Data0=deconstruct_2.YComponent)
division_2 = Division(A=deconstruct_2.XComponent, B=deconstruct_2.YComponent)
format_5 = Format(Format="{0:R}", Culture=127, Data0=division_2)
Y = Panel(format_4)

panel_17 = Panel(format_5)
deconstruct_3 = Deconstruct(Point=evaluate_length_4.Tangent)  # -> XComponent, YComponent, ZComponent
expression_3 = Expression(X=deconstruct_3.XComponent, Y=deconstruct_3.YComponent, Expression="deg(atan(x/y))")
subtraction = Subtraction(A="90", B=expression_3)
digit_scroller_3 = DigitScroller(Scroller_Digits=12, Scroller_Prefix=" ", Scroller_Radix=1, Scroller_Value=0.1225)
addition_4 = Addition(A=add_lop_bend, B=panel_14)
number = Number(division)
point_3 = Point(insert_items_2)
list_item = ListItem(List=reverse(point_3), Index=0, Wrap=False)
rotate_6 = Rotate(Geometry=point_3, Angle=3.141592654, Plane=list_item)  # -> Geometry, Transform
merge_3 = Merge(Data1=point_3, Data2=reverse(rotate_6.Geometry))
cull_duplicates = CullDuplicates(Points=merge_3, Tolerance=1e-10, CullMode=1)  # -> Points, Indices, Valence
point_4 = Point(cull_duplicates.Points)
list_item_2 = ListItem(List=point_4, Index=-1, Wrap=True)
list_item_3 = ListItem(List=reverse(cull_duplicates.Points), Index=0, Wrap=False)
deconstruct_4 = Deconstruct(Point=list_item_3)  # -> XComponent, YComponent, ZComponent
expression_4 = Expression(X=deconstruct_4.XComponent, Y=deconstruct_4.YComponent, Expression="deg(atan(x/y))")
rotate_7 = Rotate(Geometry=cull_duplicates.Points, Angle=expr("-X", degrees(expression_4)), Plane=PlaneXY(0, 0, 0))  # -> Geometry, Transform

list_item_4 = ListItem(List=reverse(rotate_7.Geometry), Index=0, Wrap=False)
deconstruct_5 = Deconstruct(Point=list_item_4)  # -> XComponent, YComponent, ZComponent
scale_nu_2 = ScaleNU(
    Geometry=rotate_7.Geometry,
    Plane=PlaneXY(0, 0, 0),
    ScaleX=expr("1/X", deconstruct_5.XComponent),
    ScaleY=expr("1/X", deconstruct_5.YComponent),
    ScaleZ=expr("1/X", deconstruct_5.ZComponent))  # -> Geometry, Transform

list_length = ListLength(List=scale_nu_2.Geometry)
rebuild_curve = RebuildCurve(Curve=rotate_5.Geometry, Degree=11, Count=list_length, Tangents=False)
rebuild_curve_2 = RebuildCurve(Curve=rebuild_curve, Degree=11, Count=list_length, Tangents=False)
rebuild_curve_3 = RebuildCurve(Curve=kinky_curve.Curve, Degree=11, Count=list_length, Tangents=False)
fit_curve = FitCurve(Curve=nurbs_curve.Curve, Degree=5, Tolerance=1e-10)  # disabled
lop = DigitScroller(Scroller_Digits=12, Scroller_Prefix="LOP", Scroller_Radix=11, Scroller_Value=4)
division_3 = Division(A=deconstruct_5.XComponent, B=deconstruct_5.YComponent)
point_5 = Point(list_item_4)
smooth_curve = SmoothCurve(Curve=interpolate_3.Curve, Steps=16, StartType=0, EndType=0, DeviationTolerance=1e-10, AngleTolerance=1e-10)  # disabled
panel_19 = Panel(cull_duplicates.Points)
format_6 = Format(Format="{0:R}", Culture=127, Data0=division_3)
panel_20 = Panel(format_6)
fast_loop_start = FastLoopStart(Iterations=lop, Data=scale_nu.Geometry)  # -> port, Counter, Data; disabled
fast_loop_end = FastLoopEnd(port=fast_loop_start.port, Exit=False, RecordData=False, TimeOutVal=0)  # disabled

scale_power = DigitScroller(Scroller_Digits=12, Scroller_Prefix="SCALE POWER", Scroller_Radix=11, Scroller_Value=16)
power_4 = Power(A="2", B=scale_power)
scale_3 = Scale(Geometry=scale_nu.Geometry, Center=Point(0, 0, 0), Factor=power_4)  # -> Geometry, Transform

addition_5 = Addition(A="1", B=division)
addition_6 = Addition(A="1", B=addition_5)

log_n_2 = LogN(Number=division, Base=2)
expression_5 = Expression(O="0.4863502813211475209", OO=log_n_2, Expression="O/4^(OO-4)")
series_4 = Series(Start=0, Step=expression_5, Count=addition_6)

bounds = Bounds(Numbers=series_4)
end_points = EndPoints(Curve=scale_3.Geometry)  # -> Start, End
rectangle_2pt = Rectangle2Pt(Plane=PlaneXY(0, 0, 0), PointA=end_points.Start, PointB=end_points.End, Radius=0)  # -> Rectangle, Length
graphmapper = GraphMapper(Curve=scale_3.Geometry, Boundary=rectangle_2pt.Rectangle, Numbers=series_4, Input=bounds, Output=bounds, bobo=True)

addition_7 = Addition(A="1", B=division)
addition_8 = Addition(A="1", B=addition_7)

log_n_3 = LogN(Number=division, Base=2)
expression_6 = Expression(O="0.4875881689164849049", OO=log_n_3, Expression="O/4^(OO-4)")
series_5 = Series(Start=0, Step=expression_6, Count=addition_8)

digit_scroller_4 = DigitScroller(Scroller_Digits=12, Scroller_Prefix=" ", Scroller_Radix=1, Scroller_Value=8)
digit_scroller_5 = DigitScroller(Scroller_Digits=12, Scroller_Prefix=" ", Scroller_Radix=7, Scroller_Value=0)
digit_scroller_6 = DigitScroller(Scroller_Digits=12, Scroller_Prefix=" ", Scroller_Radix=1, Scroller_Value=7)
digit_scroller_7 = DigitScroller(Scroller_Digits=12, Scroller_Prefix=" ", Scroller_Radix=6, Scroller_Value=0)
digit_scroller_8 = DigitScroller(Scroller_Digits=12, Scroller_Prefix=" ", Scroller_Radix=1, Scroller_Value=6)
digit_scroller_9 = DigitScroller(Scroller_Digits=12, Scroller_Prefix=" ", Scroller_Radix=6, Scroller_Value=0)
digit_scroller_10 = DigitScroller(Scroller_Digits=12, Scroller_Prefix=" ", Scroller_Radix=1, Scroller_Value=5)
digit_scroller_11 = DigitScroller(Scroller_Digits=12, Scroller_Prefix=" ", Scroller_Radix=8, Scroller_Value=30000000)
digit_scroller_12 = DigitScroller(Scroller_Digits=12, Scroller_Prefix=" ", Scroller_Radix=1, Scroller_Value=4)
digit_scroller_13 = DigitScroller(Scroller_Digits=12, Scroller_Prefix=" ", Scroller_Radix=7, Scroller_Value=3700000)
digit_scroller_14 = DigitScroller(Scroller_Digits=12, Scroller_Prefix=" ", Scroller_Radix=1, Scroller_Value=3)
digit_scroller_15 = DigitScroller(Scroller_Digits=12, Scroller_Prefix=" ", Scroller_Radix=6, Scroller_Value=100000)
digit_scroller_16 = DigitScroller(Scroller_Digits=12, Scroller_Prefix=" ", Scroller_Radix=1, Scroller_Value=2)
digit_scroller_17 = DigitScroller(Scroller_Digits=12, Scroller_Prefix=" ", Scroller_Radix=4, Scroller_Value=2100.02)
digit_scroller_18 = DigitScroller(Scroller_Digits=12, Scroller_Prefix=" ", Scroller_Radix=1, Scroller_Value=1)
digit_scroller_19 = DigitScroller(Scroller_Digits=12, Scroller_Prefix=" ", Scroller_Radix=3, Scroller_Value=22.3)
digit_scroller_20 = DigitScroller(Scroller_Digits=12, Scroller_Prefix=" ", Scroller_Radix=1, Scroller_Value=0)
digit_scroller_21 = DigitScroller(Scroller_Digits=12, Scroller_Prefix=" ", Scroller_Radix=3, Scroller_Value=0.19)
number_2 = Number(expr("X*2+1", number))

addition_9 = Addition(A="1", B=division)
addition_10 = Addition(A="1", B=addition_9)

panel_25 = Panel("0.4875881689164849049")

range = Range(Domain=Domain(0, 0.9999999999), Steps=expr("X*2", division))
expression_7 = Expression(X=range, Expression="EXP(-1/X)/(EXP(-1/X)+EXP(-1/(1-X)))")
replace_nulls = ReplaceNulls(Items=expression_7, Replacements="0")  # -> Items, Count
construct_point = ConstructPoint(XCoordinate=range, YCoordinate=replace_nulls.Items, ZCoordinate=0)
interpolate_4 = Interpolate(Vertices=construct_point, Degree=3, Periodic=False, KnotStyle=2)  # -> Curve, Length, Domain
format_7 = Format(Format="{0:R}", Culture=127, Data0=replace_nulls.Items)

addition_11 = Addition(A="1", B=division)
addition_12 = Addition(A="1", B=addition_11)

one_over_x_3 = OneOverX(Value=division)
unit_y_3 = UnitY(Factor=one_over_x_3)
unit_z_3 = UnitZ(Factor=one_over_x_3)
increase_bend_per_segment_6 = DigitScroller(Scroller_Digits=12, Scroller_Prefix="INCREASE BEND PER SEGMENT", Scroller_Radix=1, Scroller_Value=0.77246532)
increase_bend_per_segment_7 = DigitScroller(Scroller_Digits=12, Scroller_Prefix="INCREASE BEND PER SEGMENT", Scroller_Radix=1, Scroller_Value=0.4863502813)
sement_length_3 = DigitScroller(Scroller_Digits=12, Scroller_Prefix="SEMENT LENGTH", Scroller_Radix=2, Scroller_Value=0.0023)
increase_bend_per_segment_8 = DigitScroller(Scroller_Digits=12, Scroller_Prefix="INCREASE BEND PER SEGMENT", Scroller_Radix=1, Scroller_Value=0.4922217385)
unit_x_2 = UnitX(Factor=one_over_x_3)
ᔓᔕ_ᙁ_ᗩ_ᴥ_ᗩ_ᑫᑭ_иn_ᗝ_ᗩ_ᔓᔕ_ᗩ_ᙏ_ᙏ_ᗩ_ᔓᔕ_ᗩ_ᗝ_и_4 = ᔓᔕᙁᗩᴥᗩᑫᑭИNᗝᗩᔓᔕᗩᙏᙏᗩᔓᔕᗩᗝИNᑫᑭᗩᴥᗩᙁᔓᔕ(shift=1, relay=graphmapper)  # -> relay_2, result
rotate_8 = Rotate(Vector=unit_y_3, Axis=unit_z_3, Angle=expr("-X", reverse(degrees(ᔓᔕ_ᙁ_ᗩ_ᴥ_ᗩ_ᑫᑭ_иn_ᗝ_ᗩ_ᔓᔕ_ᗩ_ᙏ_ᙏ_ᗩ_ᔓᔕ_ᗩ_ᗝ_и_4.relay_2))))
ᔓᔕ_ᙁ_ᗩ_ᴥ_ᗩ_ᑫᑭ_иn_ᗝ_ᗩ_ᔓᔕ_ᗩ_ᙏ_ᙏ_ᗩ_ᔓᔕ_ᗩ_ᗝ_и_5 = ᔓᔕᙁᗩᴥᗩᑫᑭИNᗝᗩᔓᔕᗩᙏᙏᗩᔓᔕᗩᗝИNᑫᑭᗩᴥᗩᙁᔓᔕ(shift=-1, relay=rotate_8)  # -> relay_2, result
insert_items_3 = InsertItems(List=ᔓᔕ_ᙁ_ᗩ_ᴥ_ᗩ_ᑫᑭ_иn_ᗝ_ᗩ_ᔓᔕ_ᗩ_ᙏ_ᙏ_ᗩ_ᔓᔕ_ᗩ_ᗝ_и_5.relay_2, Item="{0,0,0}", Indices=0, Wrap=False)
point_6 = Point(insert_items_3)
interpolate_5 = Interpolate(Vertices=insert_items_3, Degree=3, Periodic=False, KnotStyle=2)  # -> Curve, Length, Domain

nurbs_curve_2 = NurbsCurve(Vertices=insert_items_3, Degree=2, Periodic=False)  # -> Curve, Length, Domain

evaluate_length_6 = EvaluateLength(Curve=interpolate_5.Curve, Length=1, Normalized=True)  # -> Point, Tangent, Parameter
rotate_9 = Rotate(Geometry=interpolate_5.Curve, Angle=3.141592654, Plane=evaluate_length_6.Point)  # -> Geometry, Transform
merge_4 = Merge(Data1=interpolate_5.Curve, Data2=rotate_9.Geometry)
join_curves_3 = JoinCurves(Curves=merge_4, Preserve=False)

evaluate_length_7 = EvaluateLength(Curve=join_curves_3, Length=1, Normalized=True)  # -> Point, Tangent, Parameter
angle_2 = Angle(VectorA=evaluate_length_7.Tangent, VectorB=Vector(1, 0, 0))  # -> expr("-DEG(X)", Angle), Reflex
rotate_10 = Rotate(Geometry=join_curves_3, Angle=degrees(angle_2.Angle), Plane=PlaneXY(0, 0, 0))  # -> Geometry, Transform

evaluate_length_8 = EvaluateLength(Curve=rotate_10.Geometry, Length=1, Normalized=True)  # -> Point, Tangent, Parameter
deconstruct_6 = Deconstruct(Point=evaluate_length_8.Point)  # -> XComponent, YComponent, ZComponent
scale_nu_3 = ScaleNU(
    Geometry=rotate_10.Geometry,
    Plane=PlaneXY(0, 0, 0),
    ScaleX=expr("1/X", deconstruct_6.XComponent),
    ScaleY=expr("1/X", deconstruct_6.YComponent),
    ScaleZ=expr("1/X", deconstruct_6.ZComponent))  # -> Geometry, Transform

deconstruct_7 = Deconstruct(Point=evaluate_length_8.Point)  # -> XComponent, YComponent, ZComponent
format_8 = Format(Format="{0:R}", Culture=127, Data0=deconstruct_7.XComponent)
format_9 = Format(Format="{0:R}", Culture=127, Data0=deconstruct_7.YComponent)
division_4 = Division(A=deconstruct_7.XComponent, B=deconstruct_7.YComponent)
format_10 = Format(Format="{0:R}", Culture=127, Data0=division_4)
X_2 = Panel(format_8)
Y_2 = Panel(format_9)

panel_30 = Panel(format_10)

scale_power_2 = DigitScroller(Scroller_Digits=12, Scroller_Prefix="SCALE POWER", Scroller_Radix=11, Scroller_Value=16)
power_5 = Power(A="2", B=scale_power_2)
scale_4 = Scale(Geometry=scale_nu_3.Geometry, Center=Point(0, 0, 0), Factor=power_5)  # -> Geometry, Transform

bounds_2 = Bounds(Numbers=series_5)
end_points_2 = EndPoints(Curve=scale_4.Geometry)  # -> Start, End
rectangle_2pt_2 = Rectangle2Pt(Plane=PlaneXY(0, 0, 0), PointA=end_points_2.Start, PointB=end_points_2.End, Radius=0)  # -> Rectangle, Length
graphmapper_2 = GraphMapper(Curve=scale_4.Geometry, Boundary=rectangle_2pt_2.Rectangle, Numbers=series_5, Input=bounds_2, Output=bounds_2, bobo=True)

one_over_x_4 = OneOverX(Value=division)
unit_y_4 = UnitY(Factor=one_over_x_4)
unit_z_4 = UnitZ(Factor=one_over_x_4)
increase_bend_per_segment_9 = DigitScroller(Scroller_Digits=12, Scroller_Prefix="INCREASE BEND PER SEGMENT", Scroller_Radix=1, Scroller_Value=0.77246532)
increase_bend_per_segment_10 = DigitScroller(Scroller_Digits=12, Scroller_Prefix="INCREASE BEND PER SEGMENT", Scroller_Radix=1, Scroller_Value=0.4875881689)
sement_length_4 = DigitScroller(Scroller_Digits=12, Scroller_Prefix="SEMENT LENGTH", Scroller_Radix=2, Scroller_Value=0.0023)
increase_bend_per_segment_11 = DigitScroller(Scroller_Digits=12, Scroller_Prefix="INCREASE BEND PER SEGMENT", Scroller_Radix=1, Scroller_Value=0.4922217385)
unit_x_3 = UnitX(Factor=one_over_x_4)
ᔓᔕ_ᙁ_ᗩ_ᴥ_ᗩ_ᑫᑭ_иn_ᗝ_ᗩ_ᔓᔕ_ᗩ_ᙏ_ᙏ_ᗩ_ᔓᔕ_ᗩ_ᗝ_и_6 = ᔓᔕᙁᗩᴥᗩᑫᑭИNᗝᗩᔓᔕᗩᙏᙏᗩᔓᔕᗩᗝИNᑫᑭᗩᴥᗩᙁᔓᔕ_2(shift=1, relay=graphmapper_2)  # -> relay_2, result
rotate_11 = Rotate(Vector=unit_y_4, Axis=unit_z_4, Angle=expr("-X", reverse(degrees(ᔓᔕ_ᙁ_ᗩ_ᴥ_ᗩ_ᑫᑭ_иn_ᗝ_ᗩ_ᔓᔕ_ᗩ_ᙏ_ᙏ_ᗩ_ᔓᔕ_ᗩ_ᗝ_и_6.relay_2))))
ᔓᔕ_ᙁ_ᗩ_ᴥ_ᗩ_ᑫᑭ_иn_ᗝ_ᗩ_ᔓᔕ_ᗩ_ᙏ_ᙏ_ᗩ_ᔓᔕ_ᗩ_ᗝ_и_7 = ᔓᔕᙁᗩᴥᗩᑫᑭИNᗝᗩᔓᔕᗩᙏᙏᗩᔓᔕᗩᗝИNᑫᑭᗩᴥᗩᙁᔓᔕ_2(shift=-1, relay=rotate_11)  # -> relay_2, result
insert_items_4 = InsertItems(List=ᔓᔕ_ᙁ_ᗩ_ᴥ_ᗩ_ᑫᑭ_иn_ᗝ_ᗩ_ᔓᔕ_ᗩ_ᙏ_ᙏ_ᗩ_ᔓᔕ_ᗩ_ᗝ_и_7.relay_2, Item="{0,0,0}", Indices=0, Wrap=False)
point_7 = Point(insert_items_4)
interpolate_6 = Interpolate(Vertices=insert_items_4, Degree=3, Periodic=False, KnotStyle=1)  # -> Curve, Length, Domain

nurbs_curve_3 = NurbsCurve(Vertices=insert_items_4, Degree=2, Periodic=False)  # -> Curve, Length, Domain

evaluate_length_9 = EvaluateLength(Curve=interpolate_6.Curve, Length=1, Normalized=True)  # -> Point, Tangent, Parameter
rotate_12 = Rotate(Geometry=interpolate_6.Curve, Angle=3.141592654, Plane=evaluate_length_9.Point)  # -> Geometry, Transform
merge_5 = Merge(Data1=interpolate_6.Curve, Data2=rotate_12.Geometry)
join_curves_4 = JoinCurves(Curves=merge_5, Preserve=False)

evaluate_length_10 = EvaluateLength(Curve=join_curves_4, Length=1, Normalized=True)  # -> Point, Tangent, Parameter
angle_3 = Angle(VectorA=evaluate_length_10.Tangent, VectorB=Vector(1, 0, 0))  # -> expr("-DEG(X)", Angle), Reflex
rotate_13 = Rotate(Geometry=join_curves_4, Angle=degrees(angle_3.Angle), Plane=PlaneXY(0, 0, 0))  # -> Geometry, Transform

evaluate_length_11 = EvaluateLength(Curve=rotate_13.Geometry, Length=1, Normalized=True)  # -> Point, Tangent, Parameter
deconstruct_8 = Deconstruct(Point=evaluate_length_11.Point)  # -> XComponent, YComponent, ZComponent
scale_nu_4 = ScaleNU(
    Geometry=rotate_13.Geometry,
    Plane=PlaneXY(0, 0, 0),
    ScaleX=expr("1/X", deconstruct_8.XComponent),
    ScaleY=expr("1/X", deconstruct_8.YComponent),
    ScaleZ=expr("1/X", deconstruct_8.ZComponent))  # -> Geometry, Transform

deconstruct_9 = Deconstruct(Point=evaluate_length_11.Point)  # -> XComponent, YComponent, ZComponent
format_11 = Format(Format="{0:R}", Culture=127, Data0=deconstruct_9.XComponent)
format_12 = Format(Format="{0:R}", Culture=127, Data0=deconstruct_9.YComponent)
division_5 = Division(A=deconstruct_9.XComponent, B=deconstruct_9.YComponent)
format_13 = Format(Format="{0:R}", Culture=127, Data0=division_5)
X_3 = Panel(format_11)
Y_3 = Panel(format_12)

panel_34 = Panel(format_13)

scale_power_3 = DigitScroller(Scroller_Digits=12, Scroller_Prefix="SCALE POWER", Scroller_Radix=11, Scroller_Value=16)
power_6 = Power(A="2", B=scale_power_3)
scale_5 = Scale(Geometry=scale_nu_4.Geometry, Center=Point(0, 0, 0), Factor=power_6)  # -> Geometry, Transform

digit_scroller_22 = DigitScroller(Scroller_Digits=12, Scroller_Prefix=" ", Scroller_Radix=6, Scroller_Value=0.1225)
digit_scroller_23 = DigitScroller(Scroller_Digits=12, Scroller_Prefix=" ", Scroller_Radix=6, Scroller_Value=0.1225)
digit_scroller_24 = DigitScroller(Scroller_Digits=12, Scroller_Prefix=" ", Scroller_Radix=6, Scroller_Value=0.1225)
digit_scroller_25 = DigitScroller(Scroller_Digits=12, Scroller_Prefix=" ", Scroller_Radix=6, Scroller_Value=0.1225)
digit_scroller_26 = DigitScroller(Scroller_Digits=12, Scroller_Prefix=" ", Scroller_Radix=6, Scroller_Value=0.1225)
digit_scroller_27 = DigitScroller(Scroller_Digits=12, Scroller_Prefix=" ", Scroller_Radix=6, Scroller_Value=0.1225)
digit_scroller_28 = DigitScroller(Scroller_Digits=12, Scroller_Prefix=" ", Scroller_Radix=6, Scroller_Value=0.1225)
digit_scroller_29 = DigitScroller(Scroller_Digits=12, Scroller_Prefix=" ", Scroller_Radix=6, Scroller_Value=0.1225)
digit_scroller_30 = DigitScroller(Scroller_Digits=12, Scroller_Prefix=" ", Scroller_Radix=6, Scroller_Value=0.1225)

digit_scroller_31 = DigitScroller(Scroller_Digits=12, Scroller_Prefix=" ", Scroller_Radix=6, Scroller_Value=0.1225)
digit_scroller_32 = DigitScroller(Scroller_Digits=12, Scroller_Prefix=" ", Scroller_Radix=2, Scroller_Value=0.1225)
digit_scroller_33 = DigitScroller(Scroller_Digits=12, Scroller_Prefix=" ", Scroller_Radix=6, Scroller_Value=5101.1225)
digit_scroller_34 = DigitScroller(Scroller_Digits=12, Scroller_Prefix=" ", Scroller_Radix=2, Scroller_Value=0.2225)
digit_scroller_35 = DigitScroller(Scroller_Digits=12, Scroller_Prefix=" ", Scroller_Radix=5, Scroller_Value=5.3225)
digit_scroller_36 = DigitScroller(Scroller_Digits=12, Scroller_Prefix=" ", Scroller_Radix=1, Scroller_Value=0.0725)
digit_scroller_37 = DigitScroller(Scroller_Digits=12, Scroller_Prefix=" ", Scroller_Radix=2, Scroller_Value=0.08)
digit_scroller_38 = DigitScroller(Scroller_Digits=12, Scroller_Prefix=" ", Scroller_Radix=3, Scroller_Value=0.099999999)
number_3 = Number(expr("X*2", number))

end_points_3 = EndPoints(Curve=scale_5.Geometry)  # -> Start, End
rectangle_2pt_3 = Rectangle2Pt(Plane=PlaneXY(0, 0, 0), PointA=end_points_3.Start, PointB=end_points_3.End, Radius=0)  # -> Rectangle, Length

one_over_x_5 = OneOverX(Value=division)
unit_y_5 = UnitY(Factor=one_over_x_5)
unit_z_5 = UnitZ(Factor=one_over_x_5)
increase_bend_per_segment_12 = DigitScroller(Scroller_Digits=12, Scroller_Prefix="INCREASE BEND PER SEGMENT", Scroller_Radix=1, Scroller_Value=0.77246532)
increase_bend_per_segment_13 = DigitScroller(Scroller_Digits=12, Scroller_Prefix="INCREASE BEND PER SEGMENT", Scroller_Radix=1, Scroller_Value=0.4862769659)
sement_length_5 = DigitScroller(Scroller_Digits=12, Scroller_Prefix="SEMENT LENGTH", Scroller_Radix=2, Scroller_Value=0.0023)
increase_bend_per_segment_14 = DigitScroller(Scroller_Digits=12, Scroller_Prefix="INCREASE BEND PER SEGMENT", Scroller_Radix=1, Scroller_Value=0.4922217385)
unit_x_4 = UnitX(Factor=one_over_x_5)

log_n_4 = LogN(Number=division, Base=2)
expression_8 = Expression(O=increase_bend_per_segment_13, OO=log_n_4, Expression="O/4^(OO-4)")
series_6 = Series(Start=0, Step=expression_8, Count=addition_10)

bounds_3 = Bounds(Numbers=series_6)
graphmapper_3 = GraphMapper(Curve=scale_5.Geometry, Boundary=rectangle_2pt_3.Rectangle, Numbers=series_6, Input=bounds_3, Output=bounds_3, bobo=True)

ᔓᔕ_ᙁ_ᗩ_ᴥ_ᗩ_ᑫᑭ_иn_ᗝ_ᗩ_ᔓᔕ_ᗩ_ᙏ_ᙏ_ᗩ_ᔓᔕ_ᗩ_ᗝ_и_8 = ᔓᔕᙁᗩᴥᗩᑫᑭИNᗝᗩᔓᔕᗩᙏᙏᗩᔓᔕᗩᗝИNᑫᑭᗩᴥᗩᙁᔓᔕ_2(shift=1, relay=graphmapper_3)  # -> relay_2, result
rotate_14 = Rotate(Vector=unit_y_5, Axis=unit_z_5, Angle=expr("-X", reverse(degrees(ᔓᔕ_ᙁ_ᗩ_ᴥ_ᗩ_ᑫᑭ_иn_ᗝ_ᗩ_ᔓᔕ_ᗩ_ᙏ_ᙏ_ᗩ_ᔓᔕ_ᗩ_ᗝ_и_8.relay_2))))
ᔓᔕ_ᙁ_ᗩ_ᴥ_ᗩ_ᑫᑭ_иn_ᗝ_ᗩ_ᔓᔕ_ᗩ_ᙏ_ᙏ_ᗩ_ᔓᔕ_ᗩ_ᗝ_и_9 = ᔓᔕᙁᗩᴥᗩᑫᑭИNᗝᗩᔓᔕᗩᙏᙏᗩᔓᔕᗩᗝИNᑫᑭᗩᴥᗩᙁᔓᔕ_2(shift=-1, relay=rotate_14)  # -> relay_2, result
insert_items_5 = InsertItems(List=ᔓᔕ_ᙁ_ᗩ_ᴥ_ᗩ_ᑫᑭ_иn_ᗝ_ᗩ_ᔓᔕ_ᗩ_ᙏ_ᙏ_ᗩ_ᔓᔕ_ᗩ_ᗝ_и_9.relay_2, Item="{0,0,0}", Indices=0, Wrap=False)
point_8 = Point(insert_items_5)
interpolate_7 = Interpolate(Vertices=insert_items_5, Degree=3, Periodic=False, KnotStyle=2)  # -> Curve, Length, Domain

nurbs_curve_4 = NurbsCurve(Vertices=insert_items_5, Degree=11, Periodic=False)  # -> Curve, Length, Domain

evaluate_length_12 = EvaluateLength(Curve=interpolate_7.Curve, Length=1, Normalized=True)  # -> Point, Tangent, Parameter
rotate_15 = Rotate(Geometry=interpolate_7.Curve, Angle=3.141592654, Plane=evaluate_length_12.Point)  # -> Geometry, Transform
merge_6 = Merge(Data1=interpolate_7.Curve, Data2=rotate_15.Geometry)
join_curves_5 = JoinCurves(Curves=merge_6, Preserve=False)

evaluate_length_13 = EvaluateLength(Curve=join_curves_5, Length=1, Normalized=True)  # -> Point, Tangent, Parameter
angle_4 = Angle(VectorA=evaluate_length_13.Tangent, VectorB=Vector(1, 0, 0))  # -> expr("-DEG(X)", Angle), Reflex
rotate_16 = Rotate(Geometry=join_curves_5, Angle=degrees(angle_4.Angle), Plane=PlaneXY(0, 0, 0))  # -> Geometry, Transform

evaluate_length_14 = EvaluateLength(Curve=rotate_16.Geometry, Length=1, Normalized=True)  # -> Point, Tangent, Parameter
deconstruct_10 = Deconstruct(Point=evaluate_length_14.Point)  # -> XComponent, YComponent, ZComponent
scale_nu_5 = ScaleNU(
    Geometry=rotate_16.Geometry,
    Plane=PlaneXY(0, 0, 0),
    ScaleX=expr("1/X", deconstruct_10.XComponent),
    ScaleY=expr("1/X", deconstruct_10.YComponent),
    ScaleZ=expr("1/X", deconstruct_10.ZComponent))  # -> Geometry, Transform

interpolate_t_2 = InterpolateT(Vertices=insert_items_5, TangentStart=Vector(0, 0, 0), TangentEnd=Vector(0, 0, 0), KnotStyle=2)  # -> Curve, Length, Domain

deconstruct_11 = Deconstruct(Point=evaluate_length_14.Point)  # -> XComponent, YComponent, ZComponent
format_14 = Format(Format="{0:R}", Culture=127, Data0=deconstruct_11.XComponent)
format_15 = Format(Format="{0:R}", Culture=127, Data0=deconstruct_11.YComponent)
division_6 = Division(A=deconstruct_11.XComponent, B=deconstruct_11.YComponent)
format_16 = Format(Format="{0:R}", Culture=127, Data0=division_6)
X_4 = Panel(format_14)
Y_4 = Panel(format_15)

panel_40 = Panel(format_16)

scale_power_4 = DigitScroller(Scroller_Digits=12, Scroller_Prefix="SCALE POWER", Scroller_Radix=11, Scroller_Value=16)
power_7 = Power(A="2", B=scale_power_4)
scale_6 = Scale(Geometry=scale_nu_5.Geometry, Center=Point(0, 0, 0), Factor=power_7)  # -> Geometry, Transform

end_points_4 = EndPoints(Curve=scale_6.Geometry)  # -> Start, End
rectangle_2pt_4 = Rectangle2Pt(Plane=PlaneXY(0, 0, 0), PointA=end_points_4.Start, PointB=end_points_4.End, Radius=0)  # -> Rectangle, Length

one_over_x_6 = OneOverX(Value=division)
unit_y_6 = UnitY(Factor=one_over_x_6)
unit_z_6 = UnitZ(Factor=one_over_x_6)
increase_bend_per_segment_15 = DigitScroller(Scroller_Digits=12, Scroller_Prefix="INCREASE BEND PER SEGMENT", Scroller_Radix=1, Scroller_Value=0.77246532)
increase_bend_per_segment_16 = DigitScroller(Scroller_Digits=12, Scroller_Prefix="INCREASE BEND PER SEGMENT", Scroller_Radix=1, Scroller_Value=0.4862769659)
sement_length_6 = DigitScroller(Scroller_Digits=12, Scroller_Prefix="SEMENT LENGTH", Scroller_Radix=2, Scroller_Value=0.0023)
increase_bend_per_segment_17 = DigitScroller(Scroller_Digits=12, Scroller_Prefix="INCREASE BEND PER SEGMENT", Scroller_Radix=1, Scroller_Value=0.4922217385)
unit_x_5 = UnitX(Factor=one_over_x_6)

log_n_5 = LogN(Number=division, Base=2)
expression_9 = Expression(O=increase_bend_per_segment_16, OO=log_n_5, Expression="O/4^(OO-4)")
series_7 = Series(Start=0, Step=expression_9, Count=addition_12)

bounds_4 = Bounds(Numbers=series_7)
graphmapper_4 = GraphMapper(Curve=scale_6.Geometry, Boundary=rectangle_2pt_4.Rectangle, Numbers=series_7, Input=bounds_4, Output=bounds_4, bobo=True)

ᔓᔕ_ᙁ_ᗩ_ᴥ_ᗩ_ᑫᑭ_иn_ᗝ_ᗩ_ᔓᔕ_ᗩ_ᙏ_ᙏ_ᗩ_ᔓᔕ_ᗩ_ᗝ_и_10 = ᔓᔕᙁᗩᴥᗩᑫᑭИNᗝᗩᔓᔕᗩᙏᙏᗩᔓᔕᗩᗝИNᑫᑭᗩᴥᗩᙁᔓᔕ_2(shift=1, relay=graphmapper_4)  # -> relay_2, result
rotate_17 = Rotate(Vector=unit_y_6, Axis=unit_z_6, Angle=expr("-X", reverse(degrees(ᔓᔕ_ᙁ_ᗩ_ᴥ_ᗩ_ᑫᑭ_иn_ᗝ_ᗩ_ᔓᔕ_ᗩ_ᙏ_ᙏ_ᗩ_ᔓᔕ_ᗩ_ᗝ_и_10.relay_2))))
ᔓᔕ_ᙁ_ᗩ_ᴥ_ᗩ_ᑫᑭ_иn_ᗝ_ᗩ_ᔓᔕ_ᗩ_ᙏ_ᙏ_ᗩ_ᔓᔕ_ᗩ_ᗝ_и_11 = ᔓᔕᙁᗩᴥᗩᑫᑭИNᗝᗩᔓᔕᗩᙏᙏᗩᔓᔕᗩᗝИNᑫᑭᗩᴥᗩᙁᔓᔕ_2(shift=-1, relay=rotate_17)  # -> relay_2, result
insert_items_6 = InsertItems(List=ᔓᔕ_ᙁ_ᗩ_ᴥ_ᗩ_ᑫᑭ_иn_ᗝ_ᗩ_ᔓᔕ_ᗩ_ᙏ_ᙏ_ᗩ_ᔓᔕ_ᗩ_ᗝ_и_11.relay_2, Item="{0,0,0}", Indices=0, Wrap=False)
point_9 = Point(insert_items_6)
interpolate_8 = Interpolate(Vertices=insert_items_6, Degree=3, Periodic=False, KnotStyle=2)  # -> Curve, Length, Domain

nurbs_curve_5 = NurbsCurve(Vertices=insert_items_6, Degree=11, Periodic=False)  # -> Curve, Length, Domain

evaluate_length_15 = EvaluateLength(Curve=interpolate_8.Curve, Length=1, Normalized=True)  # -> Point, Tangent, Parameter
rotate_18 = Rotate(Geometry=interpolate_8.Curve, Angle=3.141592654, Plane=evaluate_length_15.Point)  # -> Geometry, Transform
merge_7 = Merge(Data1=interpolate_8.Curve, Data2=rotate_18.Geometry)
join_curves_6 = JoinCurves(Curves=merge_7, Preserve=False)

evaluate_length_16 = EvaluateLength(Curve=join_curves_6, Length=1, Normalized=True)  # -> Point, Tangent, Parameter
angle_5 = Angle(VectorA=evaluate_length_16.Tangent, VectorB=Vector(1, 0, 0))  # -> expr("-DEG(X)", Angle), Reflex
rotate_19 = Rotate(Geometry=join_curves_6, Angle=degrees(angle_5.Angle), Plane=PlaneXY(0, 0, 0))  # -> Geometry, Transform

evaluate_length_17 = EvaluateLength(Curve=rotate_19.Geometry, Length=1, Normalized=True)  # -> Point, Tangent, Parameter
deconstruct_12 = Deconstruct(Point=evaluate_length_17.Point)  # -> XComponent, YComponent, ZComponent
scale_nu_6 = ScaleNU(
    Geometry=rotate_19.Geometry,
    Plane=PlaneXY(0, 0, 0),
    ScaleX=expr("1/X", deconstruct_12.XComponent),
    ScaleY=expr("1/X", deconstruct_12.YComponent),
    ScaleZ=expr("1/X", deconstruct_12.ZComponent))  # -> Geometry, Transform

curve = Curve(graft(scale_nu_6.Geometry))

curve_2 = Curve(graft(curve))
diference_curwature_shaped_graph = DIFERENCECURWATURESHAPEDGRAPH(
    B_2=digit_scroller_22,
    B_17=digit_scroller_23,
    B_3=digit_scroller_24,
    B_4=digit_scroller_25,
    B_5=digit_scroller_26,
    B_6=digit_scroller_27,
    B_7=digit_scroller_28,
    B_8=digit_scroller_29,
    B_9=digit_scroller_30,
    B_10=digit_scroller_31,
    B_11=digit_scroller_32,
    B_12=digit_scroller_33,
    B_13=digit_scroller_34,
    B_14=digit_scroller_35,
    B_15=digit_scroller_36,
    B_16=digit_scroller_37,
    B=digit_scroller_38,
    count=number_3,
    curve=curve_2)  # -> relay_3, relay_17, relay_4, relay_5, relay_6, relay_7, relay_8, relay_9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

evaluate_length_18 = EvaluateLength(Curve=curve_2, Length=1, Normalized=True)  # -> Point, Tangent, Parameter
vector_display_ex = VectorDisplayEx(Point=evaluate_length_18.Point, Vector=evaluate_length_18.Tangent, Colour=RGB(0, 0, 0), Width=2)
curve_3 = Curve(graft(curve))
diference_curwature_linear_graph = DIFERENCECURWATURELINEARGRAPH(
    y_component=digit_scroller_4,
    B=digit_scroller_5,
    y_component_2=digit_scroller_6,
    B_2=digit_scroller_7,
    y_component_3=digit_scroller_8,
    B_3=digit_scroller_9,
    y_component_4=digit_scroller_10,
    B_4=digit_scroller_11,
    y_component_5=digit_scroller_12,
    B_5=digit_scroller_13,
    y_component_6=digit_scroller_14,
    B_6=digit_scroller_15,
    y_component_7=digit_scroller_16,
    B_7=digit_scroller_17,
    y_component_8=digit_scroller_18,
    B_8=digit_scroller_19,
    y_component_9=digit_scroller_20,
    B_9=digit_scroller_21,
    count=number_2,
    curve=curve_3)

bar_graph = BarGraph(diference_curwature_shaped_graph.relay_3, BarColor=RGB(255, 0, 90))
bar_graph_2 = BarGraph(diference_curwature_shaped_graph.relay_17, BarColor=RGB(255, 0, 90))
bar_graph_3 = BarGraph(diference_curwature_shaped_graph.relay_4, BarColor=RGB(255, 0, 90))
bar_graph_4 = BarGraph(diference_curwature_shaped_graph.relay_5, BarColor=RGB(255, 0, 90))
bar_graph_5 = BarGraph(diference_curwature_shaped_graph.relay_6, BarColor=RGB(255, 0, 90))
bar_graph_6 = BarGraph(diference_curwature_shaped_graph.relay_7, BarColor=RGB(255, 0, 90))
bar_graph_7 = BarGraph(diference_curwature_shaped_graph.relay_8, BarColor=RGB(255, 0, 90))
bar_graph_8 = BarGraph(diference_curwature_shaped_graph.relay_9, BarColor=RGB(255, 0, 90))
bar_graph_9 = BarGraph(diference_curwature_shaped_graph.relay_10, BarColor=RGB(255, 0, 90))
bar_graph_10 = BarGraph(diference_curwature_shaped_graph.relay_11, BarColor=RGB(255, 0, 90))
bar_graph_11 = BarGraph(diference_curwature_shaped_graph.relay_12, BarColor=RGB(255, 0, 90))
bar_graph_12 = BarGraph(diference_curwature_shaped_graph.relay_2, BarColor=RGB(255, 0, 90))
bar_graph_13 = BarGraph(diference_curwature_shaped_graph.relay_13, BarColor=RGB(255, 0, 90))
bar_graph_14 = BarGraph(diference_curwature_shaped_graph.relay_14, BarColor=RGB(255, 0, 90))
bar_graph_15 = BarGraph(diference_curwature_shaped_graph.relay_15, BarColor=RGB(255, 0, 90))
bar_graph_16 = BarGraph(diference_curwature_shaped_graph.relay_16, BarColor=RGB(255, 0, 90))
bar_graph_17 = BarGraph(diference_curwature_shaped_graph.relay, BarColor=RGB(255, 0, 90))
quick_graph_8 = QuickGraph(diference_curwature_shaped_graph.relay_17, SortOrder=0)
quick_graph_9 = QuickGraph(diference_curwature_shaped_graph.relay_5, SortOrder=0)
quick_graph_10 = QuickGraph(diference_curwature_shaped_graph.relay_7, SortOrder=0)
quick_graph_11 = QuickGraph(diference_curwature_shaped_graph.relay_8, SortOrder=0)
quick_graph_12 = QuickGraph(diference_curwature_shaped_graph.relay_11, SortOrder=0)
quick_graph_13 = QuickGraph(diference_curwature_shaped_graph.relay_13, SortOrder=0)
quick_graph_14 = QuickGraph(diference_curwature_shaped_graph.relay_14, SortOrder=0)
quick_graph_15 = QuickGraph(diference_curwature_shaped_graph.relay_15, SortOrder=0)
quick_graph_16 = QuickGraph(diference_curwature_shaped_graph.relay, SortOrder=0)
quick_graph_17 = QuickGraph(diference_curwature_shaped_graph.relay_3, SortOrder=0)
quick_graph_18 = QuickGraph(diference_curwature_shaped_graph.relay_4, SortOrder=0)
quick_graph_19 = QuickGraph(diference_curwature_shaped_graph.relay_6, SortOrder=0)
quick_graph_20 = QuickGraph(diference_curwature_shaped_graph.relay_9, SortOrder=0)
quick_graph_21 = QuickGraph(diference_curwature_shaped_graph.relay_10, SortOrder=0)
quick_graph_22 = QuickGraph(diference_curwature_shaped_graph.relay_12, SortOrder=0)
quick_graph_23 = QuickGraph(diference_curwature_shaped_graph.relay_2, SortOrder=0)
quick_graph_24 = QuickGraph(diference_curwature_shaped_graph.relay_16, SortOrder=0)

interpolate_t_3 = InterpolateT(Vertices=insert_items_6, TangentStart=Vector(0, 0, 0), TangentEnd=Vector(0, 0, 0), KnotStyle=2)  # -> Curve, Length, Domain

deconstruct_13 = Deconstruct(Point=evaluate_length_17.Point)  # -> XComponent, YComponent, ZComponent
format_17 = Format(Format="{0:R}", Culture=127, Data0=deconstruct_13.XComponent)
format_18 = Format(Format="{0:R}", Culture=127, Data0=deconstruct_13.YComponent)
division_7 = Division(A=deconstruct_13.XComponent, B=deconstruct_13.YComponent)
format_19 = Format(Format="{0:R}", Culture=127, Data0=division_7)
X_5 = Panel(format_17)
Y_5 = Panel(format_18)

panel_46 = Panel(format_19)

# ==== cluster ᔓᔕᙁᗩᴥᗩᑫᑭИNᗝᗩᔓᔕᗩᙏᙏᗩᔓᔕᗩᗝИNᑫᑭᗩᴥᗩᙁᔓᔕ

shift = ClusterInput()
relay = ClusterInput()
mass_addition = MassAddition(Input=relay)  # -> Result, PartialResults
format = Format(Format="{0:R}", Culture=127, Data0=mass_addition.PartialResults)
panel = Panel(format)
format_2 = Format(Format="{0:R}", Culture=127, Data0=relay)
panel_2 = Panel(format_2)
shift_list = ShiftList(List=mass_addition.PartialResults, Shift=shift, Wrap=False)
format_3 = Format(Format="{0:R}", Culture=127, Data0=shift_list)
panel_3 = Panel(format_3)
relay_2 = ClusterOutput(shift_list)
result = ClusterOutput(mass_addition.Result)

# ==== cluster DIFERENCECURWATURESHAPEDGRAPH
curve = ClusterInput()

digit_scroller = DigitScroller(Scroller_Digits=12, Scroller_Prefix=" ", Scroller_Radix=11, Scroller_Value=87)  # disabled
create_material = CreateMaterial(Diffuse=RGB(222, 222, 222), Specular=RGB(0, 255, 255), Emission=RGB(0, 0, 0), Transparency=0.5, Shine=100)
create_material_2 = CreateMaterial(Diffuse=RGB(247, 247, 247), Specular=RGB(0, 255, 255), Emission=RGB(0, 0, 0), Transparency=0.5, Shine=100)
create_material_3 = CreateMaterial(Diffuse=RGB(176, 176, 176), Specular=RGB(0, 255, 255), Emission=RGB(0, 0, 0), Transparency=0.5, Shine=100)
curve_2 = Curve(graft(curve))
control_points = ControlPoints(Curve=curve_2)  # -> Points, Weights, Knots
list_length = ListLength(List=control_points.Points)  # -> expr("X-1", Length)
curve_degree = CurveDegree(Curve=curve_2)
expression = Expression(A=list_length, B=curve_degree, Expression="A-B+1")
length = Length(Curve=curve_2)
curvature_graph = CurvatureGraph(Curve=curve_2, Density=1, Scale=digit_scroller)  # disabled
custom_preview = CustomPreview(Geometry=curve_2, Material=create_material_3)
B = ClusterInput()
count = ClusterInput()
divide_curve = DivideCurve(Curve=curve_2, Count=count, Kinks=False)  # -> Points, Tangents, Parameters
curvature = Curvature(Curve=curve_2, Parameter=divide_curve.Parameters)  # -> Point, Curvature, Curvature_2
deconstruct_arc = DeconstructArc(Arc=curvature.Curvature_2)  # -> BasePlane, Radius, Angle
line = Line(StartPoint=curvature.Point, EndPoint=deconstruct_arc.BasePlane)
one_over_x = OneOverX(Value=deconstruct_arc.Radius)
quick_graph = QuickGraph(one_over_x, SortOrder=0)
format = Format(Format="{0:R}", Culture=127, Data0=one_over_x)  # disabled
panel = Panel(format)
bounds = Bounds(Numbers=one_over_x)
remap_numbers = RemapNumbers(Value=one_over_x, Source=bounds, Target=Domain(0, 1))  # -> Mapped, Clipped
multiplication = Multiplication(A=length, B=remap_numbers.Mapped)
multiplication_2 = Multiplication(A=multiplication, B=B)
line_sdl = LineSDL(Start=curvature.Point, Direction=curvature.Curvature, Length=expr("-X", multiplication_2))
evaluate_length = EvaluateLength(Curve=line_sdl, Length=1, Normalized=True)  # -> Point, Tangent, Parameter
interpolate = Interpolate(Vertices=evaluate_length.Point, Degree=1, Periodic=False, KnotStyle=2)  # -> Curve, Length, Domain
custom_preview_2 = CustomPreview(Geometry=line_sdl, Material=create_material_2)
relay = ClusterOutput(one_over_x)
curve_3 = Curve(interpolate.Curve)
custom_preview_3 = CustomPreview(Geometry=curve_3, Material=create_material)
number = Number(expression)
number_2 = Number(number)

replace_nulls = ReplaceNulls(Items=one_over_x, Replacements=0)  # -> Items, Count
relative_differences = RelativeDifferences(Values=replace_nulls.Items)
shift_list = ShiftList(List=relative_differences, Shift=1, Wrap=False)

replace_nulls_2 = ReplaceNulls(Items=shift_list, Replacements=0)  # -> Items, Count
relative_differences_2 = RelativeDifferences(Values=replace_nulls_2.Items)
shift_list_2 = ShiftList(List=relative_differences_2, Shift=1, Wrap=False)

replace_nulls_3 = ReplaceNulls(Items=shift_list_2, Replacements=0)  # -> Items, Count
relative_differences_3 = RelativeDifferences(Values=replace_nulls_3.Items)
shift_list_3 = ShiftList(List=relative_differences_3, Shift=1, Wrap=False)

replace_nulls_4 = ReplaceNulls(Items=shift_list_3, Replacements=0)  # -> Items, Count
relative_differences_4 = RelativeDifferences(Values=replace_nulls_4.Items)
shift_list_4 = ShiftList(List=relative_differences_4, Shift=1, Wrap=False)

replace_nulls_5 = ReplaceNulls(Items=shift_list_4, Replacements=0)  # -> Items, Count
relative_differences_5 = RelativeDifferences(Values=replace_nulls_5.Items)
shift_list_5 = ShiftList(List=relative_differences_5, Shift=1, Wrap=False)

expression_2 = Expression(O=shift_list_5, Expression="FORMAT(\"{0:R}\",O)")  # disabled
format_2 = Format(Format="{0:R}", Culture=127, Data0=shift_list_5)  # disabled
panel_2 = Panel(format_2)
relay_2 = ClusterOutput(shift_list_5)

replace_nulls_6 = ReplaceNulls(Items=shift_list_5, Replacements=0)  # -> Items, Count
relative_differences_6 = RelativeDifferences(Values=replace_nulls_6.Items)
shift_list_6 = ShiftList(List=relative_differences_6, Shift=1, Wrap=False)

replace_nulls_7 = ReplaceNulls(Items=shift_list_6, Replacements=0)  # -> Items, Count
relative_differences_7 = RelativeDifferences(Values=replace_nulls_7.Items)
shift_list_7 = ShiftList(List=relative_differences_7, Shift=1, Wrap=False)

replace_nulls_8 = ReplaceNulls(Items=shift_list_7, Replacements=0)  # -> Items, Count
relative_differences_8 = RelativeDifferences(Values=replace_nulls_8.Items)
shift_list_8 = ShiftList(List=relative_differences_8, Shift=1, Wrap=False)

replace_nulls_9 = ReplaceNulls(Items=shift_list_8, Replacements=0)  # -> Items, Count
relative_differences_9 = RelativeDifferences(Values=replace_nulls_9.Items)
shift_list_9 = ShiftList(List=relative_differences_9, Shift=1, Wrap=False)

replace_nulls_10 = ReplaceNulls(Items=shift_list_9, Replacements=0)  # -> Items, Count
relative_differences_10 = RelativeDifferences(Values=replace_nulls_10.Items)
shift_list_10 = ShiftList(List=relative_differences_10, Shift=1, Wrap=False)

replace_nulls_11 = ReplaceNulls(Items=shift_list_10, Replacements=0)  # -> Items, Count
relative_differences_11 = RelativeDifferences(Values=replace_nulls_11.Items)
shift_list_11 = ShiftList(List=relative_differences_11, Shift=1, Wrap=False)

replace_nulls_12 = ReplaceNulls(Items=shift_list_11, Replacements=0)  # -> Items, Count
relative_differences_12 = RelativeDifferences(Values=replace_nulls_12.Items)
shift_list_12 = ShiftList(List=relative_differences_12, Shift=1, Wrap=False)

replace_nulls_13 = ReplaceNulls(Items=shift_list_12, Replacements=0)  # -> Items, Count
relative_differences_13 = RelativeDifferences(Values=replace_nulls_13.Items)
shift_list_13 = ShiftList(List=relative_differences_13, Shift=1, Wrap=False)

replace_nulls_14 = ReplaceNulls(Items=shift_list_13, Replacements=0)  # -> Items, Count
relative_differences_14 = RelativeDifferences(Values=replace_nulls_14.Items)
shift_list_14 = ShiftList(List=relative_differences_14, Shift=1, Wrap=False)

replace_nulls_15 = ReplaceNulls(Items=shift_list_14, Replacements=0)  # -> Items, Count
relative_differences_15 = RelativeDifferences(Values=replace_nulls_15.Items)
shift_list_15 = ShiftList(List=relative_differences_15, Shift=1, Wrap=False)

replace_nulls_16 = ReplaceNulls(Items=shift_list_15, Replacements=0)  # -> Items, Count
relative_differences_16 = RelativeDifferences(Values=replace_nulls_16.Items)
shift_list_16 = ShiftList(List=relative_differences_16, Shift=1, Wrap=False)

format_3 = Format(Format="{0:R}", Culture=127, Data0=shift_list_16)  # disabled
panel_3 = Panel(format_3)
relay_3 = ClusterOutput(shift_list_16)

explode = Explode(Curve=curve_3, Recursive=True)  # -> Segments, Vertices
evaluate_length_2 = EvaluateLength(Curve=explode.Segments, Length=0.5, Normalized=True)  # -> Point, Tangent, Parameter
curve_closest_point = CurveClosestPoint(Point=evaluate_length_2.Point, Curve=curve_2)  # -> Point, Parameter, Distance
line_2 = Line(StartPoint=curve_closest_point.Point, EndPoint=evaluate_length_2.Point)

format_4 = Format(Format="{0:R}", Culture=127, Data0=shift_list_14)  # disabled
panel_4 = Panel(format_4)
relay_4 = ClusterOutput(shift_list_14)

format_5 = Format(Format="{0:R}", Culture=127, Data0=shift_list_13)  # disabled
panel_5 = Panel(format_5)
relay_5 = ClusterOutput(shift_list_13)

format_6 = Format(Format="{0:R}", Culture=127, Data0=shift_list_12)  # disabled
panel_6 = Panel(format_6)
relay_6 = ClusterOutput(shift_list_12)

format_7 = Format(Format="{0:R}", Culture=127, Data0=shift_list_11)  # disabled
panel_7 = Panel(format_7)
relay_7 = ClusterOutput(shift_list_11)

format_8 = Format(Format="{0:R}", Culture=127, Data0=shift_list_10)  # disabled
panel_8 = Panel(format_8)
relay_8 = ClusterOutput(shift_list_10)

format_9 = Format(Format="{0:R}", Culture=127, Data0=shift_list_9)  # disabled
panel_9 = Panel(format_9)
relay_9 = ClusterOutput(shift_list_9)

format_10 = Format(Format="{0:R}", Culture=127, Data0=shift_list_8)  # disabled
panel_10 = Panel(format_10)
relay_10 = ClusterOutput(shift_list_8)

format_11 = Format(Format="{0:R}", Culture=127, Data0=shift_list_7)  # disabled
panel_11 = Panel(format_11)
relay_11 = ClusterOutput(shift_list_7)

format_12 = Format(Format="{0:R}", Culture=127, Data0=shift_list_6)  # disabled
panel_12 = Panel(format_12)
relay_12 = ClusterOutput(shift_list_6)

format_13 = Format(Format="{0:R}", Culture=127, Data0=shift_list_4)  # disabled
panel_13 = Panel(format_13)
relay_13 = ClusterOutput(shift_list_4)

format_14 = Format(Format="{0:R}", Culture=127, Data0=shift_list_3)  # disabled
panel_14 = Panel(format_14)
relay_14 = ClusterOutput(shift_list_3)

format_15 = Format(Format="{0:R}", Culture=127, Data0=shift_list_2)  # disabled
panel_15 = Panel(format_15)
relay_15 = ClusterOutput(shift_list_2)

format_16 = Format(Format="{0:R}", Culture=127, Data0=shift_list)  # disabled
panel_16 = Panel(format_16)
relay_16 = ClusterOutput(shift_list)

format_17 = Format(Format="{0:R}", Culture=127, Data0=deconstruct_arc.Radius)  # disabled
panel_17 = Panel(format_17)

format_18 = Format(Format="{0:R}", Culture=127, Data0=shift_list_15)  # disabled
panel_18 = Panel(format_18)
relay_17 = ClusterOutput(shift_list_15)

bounds_2 = Bounds(Numbers=shift_list_16)
remap_numbers_2 = RemapNumbers(Value=shift_list_16, Source=bounds_2, Target=Domain(-1, 1))  # -> Mapped, Clipped
multiplication_3 = Multiplication(A=length, B=remap_numbers_2.Mapped)
B_2 = ClusterInput()
multiplication_4 = Multiplication(A=multiplication_3, B=B_2)

bounds_3 = Bounds(Numbers=shift_list_14)
remap_numbers_3 = RemapNumbers(Value=shift_list_14, Source=bounds_3, Target=Domain(-1, 1))  # -> Mapped, Clipped
multiplication_5 = Multiplication(A=length, B=remap_numbers_3.Mapped)
B_3 = ClusterInput()
multiplication_6 = Multiplication(A=multiplication_5, B=B_3)

bounds_4 = Bounds(Numbers=shift_list_13)
remap_numbers_4 = RemapNumbers(Value=shift_list_13, Source=bounds_4, Target=Domain(-1, 1))  # -> Mapped, Clipped
multiplication_7 = Multiplication(A=length, B=remap_numbers_4.Mapped)
B_4 = ClusterInput()
multiplication_8 = Multiplication(A=multiplication_7, B=B_4)

bounds_5 = Bounds(Numbers=shift_list_12)
remap_numbers_5 = RemapNumbers(Value=shift_list_12, Source=bounds_5, Target=Domain(-1, 1))  # -> Mapped, Clipped
multiplication_9 = Multiplication(A=length, B=remap_numbers_5.Mapped)
B_5 = ClusterInput()
multiplication_10 = Multiplication(A=multiplication_9, B=B_5)

bounds_6 = Bounds(Numbers=shift_list_11)
remap_numbers_6 = RemapNumbers(Value=shift_list_11, Source=bounds_6, Target=Domain(-1, 1))  # -> Mapped, Clipped
multiplication_11 = Multiplication(A=length, B=remap_numbers_6.Mapped)
B_6 = ClusterInput()
multiplication_12 = Multiplication(A=multiplication_11, B=B_6)

bounds_7 = Bounds(Numbers=shift_list_10)
remap_numbers_7 = RemapNumbers(Value=shift_list_10, Source=bounds_7, Target=Domain(-1, 1))  # -> Mapped, Clipped
multiplication_13 = Multiplication(A=length, B=remap_numbers_7.Mapped)
B_7 = ClusterInput()
multiplication_14 = Multiplication(A=multiplication_13, B=B_7)

bounds_8 = Bounds(Numbers=shift_list_9)
remap_numbers_8 = RemapNumbers(Value=shift_list_9, Source=bounds_8, Target=Domain(-1, 1))  # -> Mapped, Clipped
multiplication_15 = Multiplication(A=length, B=remap_numbers_8.Mapped)
B_8 = ClusterInput()
multiplication_16 = Multiplication(A=multiplication_15, B=B_8)

bounds_9 = Bounds(Numbers=shift_list_8)
remap_numbers_9 = RemapNumbers(Value=shift_list_8, Source=bounds_9, Target=Domain(-1, 1))  # -> Mapped, Clipped
multiplication_17 = Multiplication(A=length, B=remap_numbers_9.Mapped)
B_9 = ClusterInput()
multiplication_18 = Multiplication(A=multiplication_17, B=B_9)

bounds_10 = Bounds(Numbers=shift_list_7)
remap_numbers_10 = RemapNumbers(Value=shift_list_7, Source=bounds_10, Target=Domain(-1, 1))  # -> Mapped, Clipped
multiplication_19 = Multiplication(A=length, B=remap_numbers_10.Mapped)
B_10 = ClusterInput()
multiplication_20 = Multiplication(A=multiplication_19, B=B_10)
bounds_11 = Bounds(Numbers=shift_list_6)
remap_numbers_11 = RemapNumbers(Value=shift_list_6, Source=bounds_11, Target=Domain(-1, 1))  # -> Mapped, Clipped
multiplication_21 = Multiplication(A=length, B=remap_numbers_11.Mapped)
B_11 = ClusterInput()
multiplication_22 = Multiplication(A=multiplication_21, B=B_11)

bounds_12 = Bounds(Numbers=shift_list_5)
remap_numbers_12 = RemapNumbers(Value=shift_list_5, Source=bounds_12, Target=Domain(-1, 1))  # -> Mapped, Clipped
multiplication_23 = Multiplication(A=length, B=remap_numbers_12.Mapped)
B_12 = ClusterInput()
multiplication_24 = Multiplication(A=multiplication_23, B=B_12)

bounds_13 = Bounds(Numbers=shift_list_4)
remap_numbers_13 = RemapNumbers(Value=shift_list_4, Source=bounds_13, Target=Domain(-1, 1))  # -> Mapped, Clipped
multiplication_25 = Multiplication(A=length, B=remap_numbers_13.Mapped)
B_13 = ClusterInput()
multiplication_26 = Multiplication(A=multiplication_25, B=B_13)

bounds_14 = Bounds(Numbers=shift_list_3)
remap_numbers_14 = RemapNumbers(Value=shift_list_3, Source=bounds_14, Target=Domain(-1, 1))  # -> Mapped, Clipped
multiplication_27 = Multiplication(A=length, B=remap_numbers_14.Mapped)
B_14 = ClusterInput()
multiplication_28 = Multiplication(A=multiplication_27, B=B_14)

bounds_15 = Bounds(Numbers=shift_list_2)
remap_numbers_15 = RemapNumbers(Value=shift_list_2, Source=bounds_15, Target=Domain(-1, 1))  # -> Mapped, Clipped
multiplication_29 = Multiplication(A=length, B=remap_numbers_15.Mapped)
B_15 = ClusterInput()
multiplication_30 = Multiplication(A=multiplication_29, B=B_15)

bounds_16 = Bounds(Numbers=shift_list)
remap_numbers_16 = RemapNumbers(Value=shift_list, Source=bounds_16, Target=Domain(-1, 1))  # -> Mapped, Clipped
multiplication_31 = Multiplication(A=length, B=remap_numbers_16.Mapped)
B_16 = ClusterInput()
multiplication_32 = Multiplication(A=multiplication_31, B=B_16)

create_material_4 = CreateMaterial(Diffuse=RGB(214, 214, 214), Specular=RGB(0, 255, 255), Emission=RGB(0, 0, 0), Transparency=0.5, Shine=100)
create_material_5 = CreateMaterial(Diffuse=RGB(240, 240, 240), Specular=RGB(0, 255, 255), Emission=RGB(0, 0, 0), Transparency=0.5, Shine=100)
quick_graph_2 = QuickGraph(shift_list, SortOrder=0)
line_sdl_2 = LineSDL(Start=evaluate_length_2.Point, Direction=line_2, Length=expr("ABS(X)", multiplication_32))
evaluate_length_3 = EvaluateLength(Curve=line_sdl_2, Length=1, Normalized=True)  # -> Point, Tangent, Parameter
interpolate_2 = Interpolate(Vertices=evaluate_length_3.Point, Degree=1, Periodic=False, KnotStyle=2)  # -> Curve, Length, Domain
custom_preview_4 = CustomPreview(Geometry=interpolate_2.Curve, Material=create_material_4)
custom_preview_5 = CustomPreview(Geometry=line_sdl_2, Material=create_material_5)

explode_2 = Explode(Curve=interpolate_2.Curve, Recursive=True)  # -> Segments, Vertices
evaluate_length_4 = EvaluateLength(Curve=explode_2.Segments, Length=0.5, Normalized=True)  # -> Point, Tangent, Parameter
curve_closest_point_2 = CurveClosestPoint(Point=evaluate_length_4.Point, Curve=curve_2)  # -> Point, Parameter, Distance
line_3 = Line(StartPoint=curve_closest_point_2.Point, EndPoint=evaluate_length_4.Point)

create_material_6 = CreateMaterial(Diffuse=RGB(207, 207, 207), Specular=RGB(0, 255, 255), Emission=RGB(0, 0, 0), Transparency=0.5, Shine=100)
create_material_7 = CreateMaterial(Diffuse=RGB(232, 232, 232), Specular=RGB(0, 255, 255), Emission=RGB(0, 0, 0), Transparency=0.5, Shine=100)
quick_graph_3 = QuickGraph(shift_list_2, SortOrder=0)
line_sdl_3 = LineSDL(Start=evaluate_length_4.Point, Direction=line_3, Length=expr("ABS(X)", multiplication_30))
evaluate_length_5 = EvaluateLength(Curve=line_sdl_3, Length=1, Normalized=True)  # -> Point, Tangent, Parameter
interpolate_3 = Interpolate(Vertices=evaluate_length_5.Point, Degree=1, Periodic=False, KnotStyle=2)  # -> Curve, Length, Domain
custom_preview_6 = CustomPreview(Geometry=interpolate_3.Curve, Material=create_material_6)
custom_preview_7 = CustomPreview(Geometry=line_sdl_3, Material=create_material_7)

explode_3 = Explode(Curve=interpolate_3.Curve, Recursive=True)  # -> Segments, Vertices
evaluate_length_6 = EvaluateLength(Curve=explode_3.Segments, Length=0.5, Normalized=True)  # -> Point, Tangent, Parameter
curve_closest_point_3 = CurveClosestPoint(Point=evaluate_length_6.Point, Curve=curve_2)  # -> Point, Parameter, Distance
line_4 = Line(StartPoint=curve_closest_point_3.Point, EndPoint=evaluate_length_6.Point)

create_material_8 = CreateMaterial(Diffuse=RGB(199, 199, 199), Specular=RGB(0, 255, 255), Emission=RGB(0, 0, 0), Transparency=0.5, Shine=100)
create_material_9 = CreateMaterial(Diffuse=RGB(224, 224, 224), Specular=RGB(0, 255, 255), Emission=RGB(0, 0, 0), Transparency=0.5, Shine=100)
quick_graph_4 = QuickGraph(shift_list_3, SortOrder=0)
line_sdl_4 = LineSDL(Start=evaluate_length_6.Point, Direction=line_4, Length=expr("ABS(X)", multiplication_28))
evaluate_length_7 = EvaluateLength(Curve=line_sdl_4, Length=1, Normalized=True)  # -> Point, Tangent, Parameter
interpolate_4 = Interpolate(Vertices=evaluate_length_7.Point, Degree=1, Periodic=False, KnotStyle=2)  # -> Curve, Length, Domain
custom_preview_8 = CustomPreview(Geometry=interpolate_4.Curve, Material=create_material_8)
custom_preview_9 = CustomPreview(Geometry=line_sdl_4, Material=create_material_9)

explode_4 = Explode(Curve=interpolate_4.Curve, Recursive=True)  # -> Segments, Vertices
evaluate_length_8 = EvaluateLength(Curve=explode_4.Segments, Length=0.5, Normalized=True)  # -> Point, Tangent, Parameter
curve_closest_point_4 = CurveClosestPoint(Point=evaluate_length_8.Point, Curve=curve_2)  # -> Point, Parameter, Distance
line_5 = Line(StartPoint=curve_closest_point_4.Point, EndPoint=evaluate_length_8.Point)

create_material_10 = CreateMaterial(Diffuse=RGB(191, 191, 191), Specular=RGB(0, 255, 255), Emission=RGB(0, 0, 0), Transparency=0.5, Shine=100)
create_material_11 = CreateMaterial(Diffuse=RGB(217, 217, 217), Specular=RGB(0, 255, 255), Emission=RGB(0, 0, 0), Transparency=0.5, Shine=100)
quick_graph_5 = QuickGraph(shift_list_4, SortOrder=0)
line_sdl_5 = LineSDL(Start=evaluate_length_8.Point, Direction=line_5, Length=expr("ABS(X)", multiplication_26))
evaluate_length_9 = EvaluateLength(Curve=line_sdl_5, Length=1, Normalized=True)  # -> Point, Tangent, Parameter
interpolate_5 = Interpolate(Vertices=evaluate_length_9.Point, Degree=1, Periodic=False, KnotStyle=2)  # -> Curve, Length, Domain
custom_preview_10 = CustomPreview(Geometry=interpolate_5.Curve, Material=create_material_10)
custom_preview_11 = CustomPreview(Geometry=line_sdl_5, Material=create_material_11)

explode_5 = Explode(Curve=interpolate_5.Curve, Recursive=True)  # -> Segments, Vertices
evaluate_length_10 = EvaluateLength(Curve=explode_5.Segments, Length=0.5, Normalized=True)  # -> Point, Tangent, Parameter
curve_closest_point_5 = CurveClosestPoint(Point=evaluate_length_10.Point, Curve=curve_2)  # -> Point, Parameter, Distance
line_6 = Line(StartPoint=curve_closest_point_5.Point, EndPoint=evaluate_length_10.Point)

create_material_12 = CreateMaterial(Diffuse=RGB(184, 184, 184), Specular=RGB(0, 255, 255), Emission=RGB(0, 0, 0), Transparency=0.5, Shine=100)
create_material_13 = CreateMaterial(Diffuse=RGB(209, 209, 209), Specular=RGB(0, 255, 255), Emission=RGB(0, 0, 0), Transparency=0.5, Shine=100)
quick_graph_6 = QuickGraph(shift_list_5, SortOrder=0)
line_sdl_6 = LineSDL(Start=evaluate_length_10.Point, Direction=line_6, Length=expr("ABS(X)", multiplication_24))
evaluate_length_11 = EvaluateLength(Curve=line_sdl_6, Length=1, Normalized=True)  # -> Point, Tangent, Parameter
interpolate_6 = Interpolate(Vertices=evaluate_length_11.Point, Degree=1, Periodic=False, KnotStyle=2)  # -> Curve, Length, Domain
custom_preview_12 = CustomPreview(Geometry=interpolate_6.Curve, Material=create_material_12)
custom_preview_13 = CustomPreview(Geometry=line_sdl_6, Material=create_material_13)

explode_6 = Explode(Curve=interpolate_6.Curve, Recursive=True)  # -> Segments, Vertices
evaluate_length_12 = EvaluateLength(Curve=explode_6.Segments, Length=0.5, Normalized=True)  # -> Point, Tangent, Parameter
curve_closest_point_6 = CurveClosestPoint(Point=evaluate_length_12.Point, Curve=curve_2)  # -> Point, Parameter, Distance
line_7 = Line(StartPoint=curve_closest_point_6.Point, EndPoint=evaluate_length_12.Point)

create_material_14 = CreateMaterial(Diffuse=RGB(176, 176, 176), Specular=RGB(0, 255, 255), Emission=RGB(0, 0, 0), Transparency=0.5, Shine=100)
create_material_15 = CreateMaterial(Diffuse=RGB(201, 201, 201), Specular=RGB(0, 255, 255), Emission=RGB(0, 0, 0), Transparency=0.5, Shine=100)
quick_graph_7 = QuickGraph(shift_list_6, SortOrder=0)
line_sdl_7 = LineSDL(Start=evaluate_length_12.Point, Direction=line_7, Length=expr("ABS(X)", multiplication_22))
evaluate_length_13 = EvaluateLength(Curve=line_sdl_7, Length=1, Normalized=True)  # -> Point, Tangent, Parameter
interpolate_7 = Interpolate(Vertices=evaluate_length_13.Point, Degree=1, Periodic=False, KnotStyle=2)  # -> Curve, Length, Domain
custom_preview_14 = CustomPreview(Geometry=interpolate_7.Curve, Material=create_material_14)
custom_preview_15 = CustomPreview(Geometry=line_sdl_7, Material=create_material_15)

explode_7 = Explode(Curve=interpolate_7.Curve, Recursive=True)  # -> Segments, Vertices
evaluate_length_14 = EvaluateLength(Curve=explode_7.Segments, Length=0.5, Normalized=True)  # -> Point, Tangent, Parameter
curve_closest_point_7 = CurveClosestPoint(Point=evaluate_length_14.Point, Curve=curve_2)  # -> Point, Parameter, Distance
line_8 = Line(StartPoint=curve_closest_point_7.Point, EndPoint=evaluate_length_14.Point)

create_material_16 = CreateMaterial(Diffuse=RGB(168, 168, 168), Specular=RGB(0, 255, 255), Emission=RGB(0, 0, 0), Transparency=0.5, Shine=100)
create_material_17 = CreateMaterial(Diffuse=RGB(194, 194, 194), Specular=RGB(0, 255, 255), Emission=RGB(0, 0, 0), Transparency=0.5, Shine=100)
quick_graph_8 = QuickGraph(shift_list_7, SortOrder=0)
line_sdl_8 = LineSDL(Start=evaluate_length_14.Point, Direction=line_8, Length=expr("ABS(X)", multiplication_20))
evaluate_length_15 = EvaluateLength(Curve=line_sdl_8, Length=1, Normalized=True)  # -> Point, Tangent, Parameter
interpolate_8 = Interpolate(Vertices=evaluate_length_15.Point, Degree=1, Periodic=False, KnotStyle=2)  # -> Curve, Length, Domain
custom_preview_16 = CustomPreview(Geometry=interpolate_8.Curve, Material=create_material_16)
custom_preview_17 = CustomPreview(Geometry=line_sdl_8, Material=create_material_17)

explode_8 = Explode(Curve=interpolate_8.Curve, Recursive=True)  # -> Segments, Vertices
evaluate_length_16 = EvaluateLength(Curve=explode_8.Segments, Length=0.5, Normalized=True)  # -> Point, Tangent, Parameter
curve_closest_point_8 = CurveClosestPoint(Point=evaluate_length_16.Point, Curve=curve_2)  # -> Point, Parameter, Distance
line_9 = Line(StartPoint=curve_closest_point_8.Point, EndPoint=evaluate_length_16.Point)

create_material_18 = CreateMaterial(Diffuse=RGB(161, 161, 161), Specular=RGB(0, 255, 255), Emission=RGB(0, 0, 0), Transparency=0.5, Shine=100)
create_material_19 = CreateMaterial(Diffuse=RGB(186, 186, 186), Specular=RGB(0, 255, 255), Emission=RGB(0, 0, 0), Transparency=0.5, Shine=100)
quick_graph_9 = QuickGraph(shift_list_8, SortOrder=0)
line_sdl_9 = LineSDL(Start=evaluate_length_16.Point, Direction=line_9, Length=expr("ABS(X)", multiplication_18))
evaluate_length_17 = EvaluateLength(Curve=line_sdl_9, Length=1, Normalized=True)  # -> Point, Tangent, Parameter
interpolate_9 = Interpolate(Vertices=evaluate_length_17.Point, Degree=1, Periodic=False, KnotStyle=2)  # -> Curve, Length, Domain
custom_preview_18 = CustomPreview(Geometry=interpolate_9.Curve, Material=create_material_18)
custom_preview_19 = CustomPreview(Geometry=line_sdl_9, Material=create_material_19)

explode_9 = Explode(Curve=interpolate_9.Curve, Recursive=True)  # -> Segments, Vertices
evaluate_length_18 = EvaluateLength(Curve=explode_9.Segments, Length=0.5, Normalized=True)  # -> Point, Tangent, Parameter
curve_closest_point_9 = CurveClosestPoint(Point=evaluate_length_18.Point, Curve=curve_2)  # -> Point, Parameter, Distance
line_10 = Line(StartPoint=curve_closest_point_9.Point, EndPoint=evaluate_length_18.Point)

create_material_20 = CreateMaterial(Diffuse=RGB(153, 153, 153), Specular=RGB(0, 255, 255), Emission=RGB(0, 0, 0), Transparency=0.5, Shine=100)
create_material_21 = CreateMaterial(Diffuse=RGB(178, 178, 178), Specular=RGB(0, 255, 255), Emission=RGB(0, 0, 0), Transparency=0.5, Shine=100)
quick_graph_10 = QuickGraph(shift_list_9, SortOrder=0)
line_sdl_10 = LineSDL(Start=evaluate_length_18.Point, Direction=line_10, Length=expr("ABS(X)", multiplication_16))
evaluate_length_19 = EvaluateLength(Curve=line_sdl_10, Length=1, Normalized=True)  # -> Point, Tangent, Parameter
interpolate_10 = Interpolate(Vertices=evaluate_length_19.Point, Degree=1, Periodic=False, KnotStyle=2)  # -> Curve, Length, Domain
custom_preview_20 = CustomPreview(Geometry=interpolate_10.Curve, Material=create_material_20)
custom_preview_21 = CustomPreview(Geometry=line_sdl_10, Material=create_material_21)

explode_10 = Explode(Curve=interpolate_10.Curve, Recursive=True)  # -> Segments, Vertices
evaluate_length_20 = EvaluateLength(Curve=explode_10.Segments, Length=0.5, Normalized=True)  # -> Point, Tangent, Parameter
curve_closest_point_10 = CurveClosestPoint(Point=evaluate_length_20.Point, Curve=curve_2)  # -> Point, Parameter, Distance
line_11 = Line(StartPoint=curve_closest_point_10.Point, EndPoint=evaluate_length_20.Point)

create_material_22 = CreateMaterial(Diffuse=RGB(145, 145, 145), Specular=RGB(0, 255, 255), Emission=RGB(0, 0, 0), Transparency=0.5, Shine=100)
create_material_23 = CreateMaterial(Diffuse=RGB(171, 171, 171), Specular=RGB(0, 255, 255), Emission=RGB(0, 0, 0), Transparency=0.5, Shine=100)
quick_graph_11 = QuickGraph(shift_list_10, SortOrder=0)
line_sdl_11 = LineSDL(Start=evaluate_length_20.Point, Direction=line_11, Length=expr("ABS(X)", multiplication_14))
evaluate_length_21 = EvaluateLength(Curve=line_sdl_11, Length=1, Normalized=True)  # -> Point, Tangent, Parameter
interpolate_11 = Interpolate(Vertices=evaluate_length_21.Point, Degree=1, Periodic=False, KnotStyle=2)  # -> Curve, Length, Domain
custom_preview_22 = CustomPreview(Geometry=interpolate_11.Curve, Material=create_material_22)
custom_preview_23 = CustomPreview(Geometry=line_sdl_11, Material=create_material_23)

explode_11 = Explode(Curve=interpolate_11.Curve, Recursive=True)  # -> Segments, Vertices
evaluate_length_22 = EvaluateLength(Curve=explode_11.Segments, Length=0.5, Normalized=True)  # -> Point, Tangent, Parameter
curve_closest_point_11 = CurveClosestPoint(Point=evaluate_length_22.Point, Curve=curve_2)  # -> Point, Parameter, Distance
line_12 = Line(StartPoint=curve_closest_point_11.Point, EndPoint=evaluate_length_22.Point)

create_material_24 = CreateMaterial(Diffuse=RGB(138, 138, 138), Specular=RGB(0, 255, 255), Emission=RGB(0, 0, 0), Transparency=0.5, Shine=100)
create_material_25 = CreateMaterial(Diffuse=RGB(163, 163, 163), Specular=RGB(0, 255, 255), Emission=RGB(0, 0, 0), Transparency=0.5, Shine=100)
quick_graph_12 = QuickGraph(shift_list_11, SortOrder=0)
line_sdl_12 = LineSDL(Start=evaluate_length_22.Point, Direction=line_12, Length=expr("ABS(X)", multiplication_12))
evaluate_length_23 = EvaluateLength(Curve=line_sdl_12, Length=1, Normalized=True)  # -> Point, Tangent, Parameter
interpolate_12 = Interpolate(Vertices=evaluate_length_23.Point, Degree=1, Periodic=False, KnotStyle=2)  # -> Curve, Length, Domain
custom_preview_24 = CustomPreview(Geometry=interpolate_12.Curve, Material=create_material_24)
custom_preview_25 = CustomPreview(Geometry=line_sdl_12, Material=create_material_25)

explode_12 = Explode(Curve=interpolate_12.Curve, Recursive=True)  # -> Segments, Vertices
evaluate_length_24 = EvaluateLength(Curve=explode_12.Segments, Length=0.5, Normalized=True)  # -> Point, Tangent, Parameter
curve_closest_point_12 = CurveClosestPoint(Point=evaluate_length_24.Point, Curve=curve_2)  # -> Point, Parameter, Distance
line_13 = Line(StartPoint=curve_closest_point_12.Point, EndPoint=evaluate_length_24.Point)

create_material_26 = CreateMaterial(Diffuse=RGB(130, 130, 130), Specular=RGB(0, 255, 255), Emission=RGB(0, 0, 0), Transparency=0.5, Shine=100)
create_material_27 = CreateMaterial(Diffuse=RGB(156, 156, 156), Specular=RGB(0, 255, 255), Emission=RGB(0, 0, 0), Transparency=0.5, Shine=100)
quick_graph_13 = QuickGraph(shift_list_12, SortOrder=0)
line_sdl_13 = LineSDL(Start=evaluate_length_24.Point, Direction=line_13, Length=expr("ABS(X)", multiplication_10))
evaluate_length_25 = EvaluateLength(Curve=line_sdl_13, Length=1, Normalized=True)  # -> Point, Tangent, Parameter
interpolate_13 = Interpolate(Vertices=evaluate_length_25.Point, Degree=1, Periodic=False, KnotStyle=2)  # -> Curve, Length, Domain
custom_preview_26 = CustomPreview(Geometry=interpolate_13.Curve, Material=create_material_26)
custom_preview_27 = CustomPreview(Geometry=line_sdl_13, Material=create_material_27)

explode_13 = Explode(Curve=interpolate_13.Curve, Recursive=True)  # -> Segments, Vertices
evaluate_length_26 = EvaluateLength(Curve=explode_13.Segments, Length=0.5, Normalized=True)  # -> Point, Tangent, Parameter
curve_closest_point_13 = CurveClosestPoint(Point=evaluate_length_26.Point, Curve=curve_2)  # -> Point, Parameter, Distance
line_14 = Line(StartPoint=curve_closest_point_13.Point, EndPoint=evaluate_length_26.Point)

create_material_28 = CreateMaterial(Diffuse=RGB(122, 122, 122), Specular=RGB(0, 255, 255), Emission=RGB(0, 0, 0), Transparency=0.5, Shine=100)
create_material_29 = CreateMaterial(Diffuse=RGB(148, 148, 148), Specular=RGB(0, 255, 255), Emission=RGB(0, 0, 0), Transparency=0.5, Shine=100)
quick_graph_14 = QuickGraph(shift_list_13, SortOrder=0)
line_sdl_14 = LineSDL(Start=evaluate_length_26.Point, Direction=line_14, Length=expr("ABS(X)", multiplication_8))
evaluate_length_27 = EvaluateLength(Curve=line_sdl_14, Length=1, Normalized=True)  # -> Point, Tangent, Parameter
interpolate_14 = Interpolate(Vertices=evaluate_length_27.Point, Degree=1, Periodic=False, KnotStyle=2)  # -> Curve, Length, Domain
custom_preview_28 = CustomPreview(Geometry=interpolate_14.Curve, Material=create_material_28)
custom_preview_29 = CustomPreview(Geometry=line_sdl_14, Material=create_material_29)

explode_14 = Explode(Curve=interpolate_14.Curve, Recursive=True)  # -> Segments, Vertices
evaluate_length_28 = EvaluateLength(Curve=explode_14.Segments, Length=0.5, Normalized=True)  # -> Point, Tangent, Parameter
curve_closest_point_14 = CurveClosestPoint(Point=evaluate_length_28.Point, Curve=curve_2)  # -> Point, Parameter, Distance
line_15 = Line(StartPoint=curve_closest_point_14.Point, EndPoint=evaluate_length_28.Point)

create_material_30 = CreateMaterial(Diffuse=RGB(115, 115, 115), Specular=RGB(0, 255, 255), Emission=RGB(0, 0, 0), Transparency=0.5, Shine=100)
create_material_31 = CreateMaterial(Diffuse=RGB(140, 140, 140), Specular=RGB(0, 255, 255), Emission=RGB(0, 0, 0), Transparency=0.5, Shine=100)
quick_graph_15 = QuickGraph(shift_list_14, SortOrder=0)
line_sdl_15 = LineSDL(Start=evaluate_length_28.Point, Direction=line_15, Length=expr("ABS(X)", multiplication_6))
evaluate_length_29 = EvaluateLength(Curve=line_sdl_15, Length=1, Normalized=True)  # -> Point, Tangent, Parameter
interpolate_15 = Interpolate(Vertices=evaluate_length_29.Point, Degree=1, Periodic=False, KnotStyle=2)  # -> Curve, Length, Domain
custom_preview_30 = CustomPreview(Geometry=interpolate_15.Curve, Material=create_material_30)
custom_preview_31 = CustomPreview(Geometry=line_sdl_15, Material=create_material_31)

explode_15 = Explode(Curve=interpolate_15.Curve, Recursive=True)  # -> Segments, Vertices
evaluate_length_30 = EvaluateLength(Curve=explode_15.Segments, Length=0.5, Normalized=True)  # -> Point, Tangent, Parameter
curve_closest_point_15 = CurveClosestPoint(Point=evaluate_length_30.Point, Curve=curve_2)  # -> Point, Parameter, Distance
line_16 = Line(StartPoint=curve_closest_point_15.Point, EndPoint=evaluate_length_30.Point)

bounds_17 = Bounds(Numbers=shift_list_15)
remap_numbers_17 = RemapNumbers(Value=shift_list_15, Source=bounds_17, Target=Domain(-1, 1))  # -> Mapped, Clipped
multiplication_33 = Multiplication(A=length, B=remap_numbers_17.Mapped)
B_17 = ClusterInput()
multiplication_34 = Multiplication(A=multiplication_33, B=B_17)

create_material_32 = CreateMaterial(Diffuse=RGB(107, 107, 107), Specular=RGB(0, 255, 255), Emission=RGB(0, 0, 0), Transparency=0.5, Shine=100)
create_material_33 = CreateMaterial(Diffuse=RGB(133, 133, 133), Specular=RGB(0, 255, 255), Emission=RGB(0, 0, 0), Transparency=0.5, Shine=100)
quick_graph_16 = QuickGraph(shift_list_15, SortOrder=0)
line_sdl_16 = LineSDL(Start=evaluate_length_30.Point, Direction=line_16, Length=expr("ABS(X)", multiplication_34))
evaluate_length_31 = EvaluateLength(Curve=line_sdl_16, Length=1, Normalized=True)  # -> Point, Tangent, Parameter
interpolate_16 = Interpolate(Vertices=evaluate_length_31.Point, Degree=1, Periodic=False, KnotStyle=2)  # -> Curve, Length, Domain
custom_preview_32 = CustomPreview(Geometry=interpolate_16.Curve, Material=create_material_32)
custom_preview_33 = CustomPreview(Geometry=line_sdl_16, Material=create_material_33)

explode_16 = Explode(Curve=interpolate_16.Curve, Recursive=True)  # -> Segments, Vertices
evaluate_length_32 = EvaluateLength(Curve=explode_16.Segments, Length=0.5, Normalized=True)  # -> Point, Tangent, Parameter
curve_closest_point_16 = CurveClosestPoint(Point=evaluate_length_32.Point, Curve=curve_2)  # -> Point, Parameter, Distance
line_17 = Line(StartPoint=curve_closest_point_16.Point, EndPoint=evaluate_length_32.Point)

create_material_34 = CreateMaterial(Diffuse=RGB(99, 99, 99), Specular=RGB(0, 255, 255), Emission=RGB(0, 0, 0), Transparency=0.5, Shine=100)
create_material_35 = CreateMaterial(Diffuse=RGB(125, 125, 125), Specular=RGB(0, 255, 255), Emission=RGB(0, 0, 0), Transparency=0.5, Shine=100)
quick_graph_17 = QuickGraph(shift_list_16, SortOrder=0)
line_sdl_17 = LineSDL(Start=evaluate_length_32.Point, Direction=line_17, Length=expr("ABS(X)", multiplication_4))
evaluate_length_33 = EvaluateLength(Curve=line_sdl_17, Length=1, Normalized=True)  # -> Point, Tangent, Parameter
interpolate_17 = Interpolate(Vertices=evaluate_length_33.Point, Degree=1, Periodic=False, KnotStyle=2)  # -> Curve, Length, Domain
custom_preview_34 = CustomPreview(Geometry=interpolate_17.Curve, Material=create_material_34)
custom_preview_35 = CustomPreview(Geometry=line_sdl_17, Material=create_material_35)

# ==== cluster DIFERENCECURWATURELINEARGRAPH
y_component = ClusterInput()
y_component_2 = ClusterInput()
y_component_3 = ClusterInput()
y_component_4 = ClusterInput()
y_component_5 = ClusterInput()
y_component_6 = ClusterInput()
y_component_7 = ClusterInput()
y_component_8 = ClusterInput()
y_component_9 = ClusterInput()
B = ClusterInput()
B_2 = ClusterInput()
B_3 = ClusterInput()
B_4 = ClusterInput()
B_5 = ClusterInput()
B_6 = ClusterInput()
B_7 = ClusterInput()
B_8 = ClusterInput()
B_9 = ClusterInput()

line_sdl = LineSDL(Start=Point(-2.121093912, 1.99985794, 0), Direction=Vector(0.0625, 0.0625, 0), Length=1)

line_sdl_2 = LineSDL(Start=Point(0, 0, 0), Direction=Vector(1, 0, 0), Length=1)

create_material = CreateMaterial(Diffuse=RGB(161, 161, 161), Specular=RGB(0, 255, 255), Emission=RGB(0, 0, 0), Transparency=0.5, Shine=100)

create_material_2 = CreateMaterial(Diffuse=RGB(186, 186, 186), Specular=RGB(0, 255, 255), Emission=RGB(0, 0, 0), Transparency=0.5, Shine=100)

create_material_3 = CreateMaterial(Diffuse=RGB(168, 168, 168), Specular=RGB(0, 255, 255), Emission=RGB(0, 0, 0), Transparency=0.5, Shine=100)

create_material_4 = CreateMaterial(Diffuse=RGB(194, 194, 194), Specular=RGB(0, 255, 255), Emission=RGB(0, 0, 0), Transparency=0.5, Shine=100)

create_material_5 = CreateMaterial(Diffuse=RGB(176, 176, 176), Specular=RGB(0, 255, 255), Emission=RGB(0, 0, 0), Transparency=0.5, Shine=100)

create_material_6 = CreateMaterial(Diffuse=RGB(201, 201, 201), Specular=RGB(0, 255, 255), Emission=RGB(0, 0, 0), Transparency=0.5, Shine=100)

create_material_7 = CreateMaterial(Diffuse=RGB(184, 184, 184), Specular=RGB(0, 255, 255), Emission=RGB(0, 0, 0), Transparency=0.5, Shine=100)

create_material_8 = CreateMaterial(Diffuse=RGB(209, 209, 209), Specular=RGB(0, 255, 255), Emission=RGB(0, 0, 0), Transparency=0.5, Shine=100)

create_material_9 = CreateMaterial(Diffuse=RGB(191, 191, 191), Specular=RGB(0, 255, 255), Emission=RGB(0, 0, 0), Transparency=0.5, Shine=100)

create_material_10 = CreateMaterial(Diffuse=RGB(217, 217, 217), Specular=RGB(0, 255, 255), Emission=RGB(0, 0, 0), Transparency=0.5, Shine=100)

create_material_11 = CreateMaterial(Diffuse=RGB(199, 199, 199), Specular=RGB(0, 255, 255), Emission=RGB(0, 0, 0), Transparency=0.5, Shine=100)

create_material_12 = CreateMaterial(Diffuse=RGB(224, 224, 224), Specular=RGB(0, 255, 255), Emission=RGB(0, 0, 0), Transparency=0.5, Shine=100)

create_material_13 = CreateMaterial(Diffuse=RGB(207, 207, 207), Specular=RGB(0, 255, 255), Emission=RGB(0, 0, 0), Transparency=0.5, Shine=100)

create_material_14 = CreateMaterial(Diffuse=RGB(232, 232, 232), Specular=RGB(0, 255, 255), Emission=RGB(0, 0, 0), Transparency=0.5, Shine=100)

create_material_15 = CreateMaterial(Diffuse=RGB(214, 214, 214), Specular=RGB(0, 255, 255), Emission=RGB(0, 0, 0), Transparency=0.5, Shine=100)

create_material_16 = CreateMaterial(Diffuse=RGB(240, 240, 240), Specular=RGB(0, 255, 255), Emission=RGB(0, 0, 0), Transparency=0.5, Shine=100)

create_material_17 = CreateMaterial(Diffuse=RGB(222, 222, 222), Specular=RGB(0, 255, 255), Emission=RGB(0, 0, 0), Transparency=0.5, Shine=100)

create_material_18 = CreateMaterial(Diffuse=RGB(247, 247, 247), Specular=RGB(0, 255, 255), Emission=RGB(0, 0, 0), Transparency=0.5, Shine=100)

count = ClusterInput()
curve = ClusterInput()
curve_2 = Curve(graft(curve))
divide_curve = DivideCurve(Curve=curve_2, Count=count, Kinks=False)  # -> Points, Tangents, Parameters
curvature = Curvature(Curve=curve_2, Parameter=divide_curve.Parameters)  # -> Point, Curvature, Curvature_2
deconstruct_arc = DeconstructArc(Arc=curvature.Curvature_2)  # -> BasePlane, Radius, Angle
expression = Expression(O=deconstruct_arc.Radius, Expression="FORMAT(\"{0:R}\",O)")
panel = Panel(expression)
quick_graph = QuickGraph(deconstruct_arc.Radius, SortOrder=0)
curve_degree = CurveDegree(Curve=curve_2)
one_over_x = OneOverX(Value=deconstruct_arc.Radius)

expression_2 = Expression(O=one_over_x, Expression="FORMAT(\"{0:R}\",O)")
panel_2 = Panel(expression_2)

replace_nulls = ReplaceNulls(Items=one_over_x, Replacements=0)  # -> Items, Count
relative_differences = RelativeDifferences(Values=replace_nulls.Items)

control_points = ControlPoints(Curve=curve_2)  # -> Points, Weights, Knots
list_length = ListLength(List=control_points.Points)  # -> expr("X-1", Length)

expression_3 = Expression(O=relative_differences, Expression="FORMAT(\"{0:R}\",O)")
panel_3 = Panel(expression_3)
quick_graph_2 = QuickGraph(relative_differences, SortOrder=0)
multiplication = Multiplication(A=relative_differences, B=B_8)

quick_graph_3 = QuickGraph(one_over_x, SortOrder=0)
multiplication_2 = Multiplication(A=one_over_x, B=B_9)

replace_nulls_2 = ReplaceNulls(Items=relative_differences, Replacements=0)  # -> Items, Count
relative_differences_2 = RelativeDifferences(Values=replace_nulls_2.Items)
expression_4 = Expression(O=relative_differences_2, Expression="FORMAT(\"{0:R}\",O)")
panel_4 = Panel(expression_4)
quick_graph_4 = QuickGraph(relative_differences_2, SortOrder=0)
multiplication_3 = Multiplication(A=relative_differences_2, B=B_7)

replace_nulls_3 = ReplaceNulls(Items=relative_differences_2, Replacements=0)  # -> Items, Count
relative_differences_3 = RelativeDifferences(Values=replace_nulls_3.Items)
expression_5 = Expression(O=relative_differences_3, Expression="FORMAT(\"{0:R}\",O)")
panel_5 = Panel(expression_5)
quick_graph_5 = QuickGraph(relative_differences_3, SortOrder=0)
multiplication_4 = Multiplication(A=relative_differences_3, B=B_6)

replace_nulls_4 = ReplaceNulls(Items=relative_differences_3, Replacements=0)  # -> Items, Count
relative_differences_4 = RelativeDifferences(Values=replace_nulls_4.Items)
expression_6 = Expression(O=relative_differences_4, Expression="FORMAT(\"{0:R}\",O)")
panel_6 = Panel(expression_6)
quick_graph_6 = QuickGraph(relative_differences_4, SortOrder=0)
multiplication_5 = Multiplication(A=relative_differences_4, B=B_5)

replace_nulls_5 = ReplaceNulls(Items=relative_differences_4, Replacements=0)  # -> Items, Count
relative_differences_5 = RelativeDifferences(Values=replace_nulls_5.Items)
expression_7 = Expression(O=relative_differences_5, Expression="FORMAT(\"{0:R}\",O)")
panel_7 = Panel(expression_7)
quick_graph_7 = QuickGraph(relative_differences_5, SortOrder=0)
multiplication_6 = Multiplication(A=relative_differences_5, B=B_4)

replace_nulls_6 = ReplaceNulls(Items=relative_differences_5, Replacements=0)  # -> Items, Count
relative_differences_6 = RelativeDifferences(Values=replace_nulls_6.Items)

expression_8 = Expression(O=relative_differences_6, Expression="FORMAT(\"{0:R}\",O)")
panel_8 = Panel(expression_8)
quick_graph_8 = QuickGraph(relative_differences_6, SortOrder=0)
multiplication_7 = Multiplication(A=relative_differences_6, B=B_3)

replace_nulls_7 = ReplaceNulls(Items=relative_differences_6, Replacements=0)  # -> Items, Count
relative_differences_7 = RelativeDifferences(Values=replace_nulls_7.Items)
expression_9 = Expression(O=relative_differences_7, Expression="FORMAT(\"{0:R}\",O)")
panel_9 = Panel(expression_9)
quick_graph_9 = QuickGraph(relative_differences_7, SortOrder=0)
multiplication_8 = Multiplication(A=relative_differences_7, B=B_2)

replace_nulls_8 = ReplaceNulls(Items=relative_differences_7, Replacements=0)  # -> Items, Count
relative_differences_8 = RelativeDifferences(Values=replace_nulls_8.Items)
expression_10 = Expression(O=relative_differences_8, Expression="FORMAT(\"{0:R}\",O)")
panel_10 = Panel(expression_10)
quick_graph_10 = QuickGraph(relative_differences_8, SortOrder=0)
multiplication_9 = Multiplication(A=relative_differences_8, B=B)

expression_11 = Expression(A=list_length, B=curve_degree, Expression="A-B+1")
number = Number(expression_11)

divide_curve_2 = DivideCurve(Curve=line_sdl_2, Count=number, Kinks=False)  # -> Points, Tangents, Parameters
line_sdl_3 = LineSDL(Start=divide_curve_2.Points, Direction=Vector(0, 1, 0), Length=multiplication_2)

curve_3 = Curve(line_sdl_3)

list_length_2 = ListLength(List=curve_2)  # -> flatten(Length)
mass_addition = MassAddition(Input=list_length_2)  # -> Result, PartialResults
panel_11 = Panel(mass_addition.Result)
series = Series(Start=1, Step=1, Count=panel_11)  # -> graft(Series)
vector_xyz = VectorXYZ(XComponent=expr("-X", series), YComponent=y_component_9, ZComponent=0)  # -> Vector, Length
move = Move(Geometry=curve_3, Motion=vector_xyz.Vector)  # -> Geometry, Transform
evaluate_length = EvaluateLength(Curve=move.Geometry, Length=1, Normalized=True)  # -> Point, Tangent, Parameter
interpolate = Interpolate(Vertices=evaluate_length.Point, Degree=1, Periodic=False, KnotStyle=2)  # -> Curve, Length, Domain

line_sdl_4 = LineSDL(Start=divide_curve_2.Points, Direction=Vector(0, 1, 0), Length=multiplication_9)
vector_xyz_2 = VectorXYZ(XComponent=expr("-X", series), YComponent=y_component, ZComponent=0)  # -> Vector, Length
move_2 = Move(Geometry=line_sdl_4, Motion=vector_xyz_2.Vector)  # -> Geometry, Transform
evaluate_length_2 = EvaluateLength(Curve=move_2.Geometry, Length=1, Normalized=True)  # -> Point, Tangent, Parameter
interpolate_2 = Interpolate(Vertices=evaluate_length_2.Point, Degree=1, Periodic=False, KnotStyle=2)  # -> Curve, Length, Domain

line_sdl_5 = LineSDL(Start=divide_curve_2.Points, Direction=Vector(0, 1, 0), Length=multiplication_8)
vector_xyz_3 = VectorXYZ(XComponent=expr("-X", series), YComponent=y_component_2, ZComponent=0)  # -> Vector, Length
move_3 = Move(Geometry=line_sdl_5, Motion=vector_xyz_3.Vector)  # -> Geometry, Transform
evaluate_length_3 = EvaluateLength(Curve=move_3.Geometry, Length=1, Normalized=True)  # -> Point, Tangent, Parameter
interpolate_3 = Interpolate(Vertices=evaluate_length_3.Point, Degree=1, Periodic=False, KnotStyle=2)  # -> Curve, Length, Domain

line_sdl_6 = LineSDL(Start=divide_curve_2.Points, Direction=Vector(0, 1, 0), Length=multiplication_7)
vector_xyz_4 = VectorXYZ(XComponent=expr("-X", series), YComponent=y_component_3, ZComponent=0)  # -> Vector, Length
move_4 = Move(Geometry=line_sdl_6, Motion=vector_xyz_4.Vector)  # -> Geometry, Transform
evaluate_length_4 = EvaluateLength(Curve=move_4.Geometry, Length=1, Normalized=True)  # -> Point, Tangent, Parameter
interpolate_4 = Interpolate(Vertices=evaluate_length_4.Point, Degree=1, Periodic=False, KnotStyle=2)  # -> Curve, Length, Domain

line_sdl_7 = LineSDL(Start=divide_curve_2.Points, Direction=Vector(0, 1, 0), Length=multiplication_6)
vector_xyz_5 = VectorXYZ(XComponent=expr("-X", series), YComponent=y_component_4, ZComponent=0)  # -> Vector, Length
move_5 = Move(Geometry=line_sdl_7, Motion=vector_xyz_5.Vector)  # -> Geometry, Transform
evaluate_length_5 = EvaluateLength(Curve=move_5.Geometry, Length=1, Normalized=True)  # -> Point, Tangent, Parameter
interpolate_5 = Interpolate(Vertices=evaluate_length_5.Point, Degree=1, Periodic=False, KnotStyle=2)  # -> Curve, Length, Domain

line_sdl_8 = LineSDL(Start=divide_curve_2.Points, Direction=Vector(0, 1, 0), Length=multiplication_5)
vector_xyz_6 = VectorXYZ(XComponent=expr("-X", series), YComponent=y_component_5, ZComponent=0)  # -> Vector, Length
move_6 = Move(Geometry=line_sdl_8, Motion=vector_xyz_6.Vector)  # -> Geometry, Transform
evaluate_length_6 = EvaluateLength(Curve=move_6.Geometry, Length=1, Normalized=True)  # -> Point, Tangent, Parameter
interpolate_6 = Interpolate(Vertices=evaluate_length_6.Point, Degree=1, Periodic=False, KnotStyle=2)  # -> Curve, Length, Domain

line_sdl_9 = LineSDL(Start=divide_curve_2.Points, Direction=Vector(0, 1, 0), Length=multiplication_4)
vector_xyz_7 = VectorXYZ(XComponent=expr("-X", series), YComponent=y_component_6, ZComponent=0)  # -> Vector, Length
move_7 = Move(Geometry=line_sdl_9, Motion=vector_xyz_7.Vector)  # -> Geometry, Transform
evaluate_length_7 = EvaluateLength(Curve=move_7.Geometry, Length=1, Normalized=True)  # -> Point, Tangent, Parameter
interpolate_7 = Interpolate(Vertices=evaluate_length_7.Point, Degree=1, Periodic=False, KnotStyle=2)  # -> Curve, Length, Domain

line_sdl_10 = LineSDL(Start=divide_curve_2.Points, Direction=Vector(0, 1, 0), Length=multiplication_3)
vector_xyz_8 = VectorXYZ(XComponent=expr("-X", series), YComponent=y_component_7, ZComponent=0)  # -> Vector, Length
move_8 = Move(Geometry=line_sdl_10, Motion=vector_xyz_8.Vector)  # -> Geometry, Transform
evaluate_length_8 = EvaluateLength(Curve=move_8.Geometry, Length=1, Normalized=True)  # -> Point, Tangent, Parameter
interpolate_8 = Interpolate(Vertices=evaluate_length_8.Point, Degree=1, Periodic=False, KnotStyle=2)  # -> Curve, Length, Domain

line_sdl_11 = LineSDL(Start=divide_curve_2.Points, Direction=Vector(0, 1, 0), Length=multiplication)
vector_xyz_9 = VectorXYZ(XComponent=expr("-X", series), YComponent=y_component_8, ZComponent=0)  # -> Vector, Length
move_9 = Move(Geometry=line_sdl_11, Motion=vector_xyz_9.Vector)  # -> Geometry, Transform
evaluate_length_9 = EvaluateLength(Curve=move_9.Geometry, Length=1, Normalized=True)  # -> Point, Tangent, Parameter
interpolate_9 = Interpolate(Vertices=evaluate_length_9.Point, Degree=1, Periodic=False, KnotStyle=2)  # -> Curve, Length, Domain

custom_preview = CustomPreview(Geometry=interpolate_2.Curve, Material=create_material)

custom_preview_2 = CustomPreview(Geometry=move_2.Geometry, Material=create_material_2)

custom_preview_3 = CustomPreview(Geometry=interpolate_3.Curve, Material=create_material_3)

custom_preview_4 = CustomPreview(Geometry=move_3.Geometry, Material=create_material_4)

custom_preview_5 = CustomPreview(Geometry=interpolate_4.Curve, Material=create_material_5)

custom_preview_6 = CustomPreview(Geometry=move_4.Geometry, Material=create_material_6)

custom_preview_7 = CustomPreview(Geometry=interpolate_5.Curve, Material=create_material_7)

custom_preview_8 = CustomPreview(Geometry=move_5.Geometry, Material=create_material_8)

custom_preview_9 = CustomPreview(Geometry=interpolate_6.Curve, Material=create_material_9)

custom_preview_10 = CustomPreview(Geometry=move_6.Geometry, Material=create_material_10)

custom_preview_11 = CustomPreview(Geometry=interpolate_7.Curve, Material=create_material_11)

custom_preview_12 = CustomPreview(Geometry=move_7.Geometry, Material=create_material_12)

custom_preview_13 = CustomPreview(Geometry=interpolate_8.Curve, Material=create_material_13)

custom_preview_14 = CustomPreview(Geometry=move_8.Geometry, Material=create_material_14)

custom_preview_15 = CustomPreview(Geometry=interpolate_9.Curve, Material=create_material_15)

custom_preview_16 = CustomPreview(Geometry=move_9.Geometry, Material=create_material_16)

custom_preview_17 = CustomPreview(Geometry=interpolate.Curve, Material=create_material_17)

custom_preview_18 = CustomPreview(Geometry=move.Geometry, Material=create_material_18)

# ==== cluster GHPythonRemote: Connects the Grasshopper Python component to an external Python instance.
python = PythonScript()  # -> default_working_dir
# ---------- python: Python ----------
from os import path
from Grasshopper.Folders import UserObjectFolders

cluster_comp = ghenv.Component.OnPingDocument().Owner
parent_doc_path = cluster_comp.OnPingDocument().FilePath

if parent_doc_path is not None:
    # Get path to parent GH document
    default_working_dir = path.abspath(path.dirname(parent_doc_path))
else:
    # Fallback to path to user objects default dir
    uo_folder = path.abspath(UserObjectFolders[0])
    if path.isdir(path.join(uo_folder, "gh-python-remote")):
        uo_folder = path.abspath(path.join(uo_folder, "gh-python-remote"))
    default_working_dir = uo_folder
# ---------- end python ----------
# GH to python remote example.
# ⓒ Pierre Cuvilliers, 2017-2022
# Released under the MIT license
# github.com/pilcru/ghpythonremote
# Runs and connects to an external python engine, and
# assigns imported modules to scriptcontext.sticky variables.
# 
# Arguments:
#       code (str): Path to the GH_to_python_sticky.py code file.
#       location (str): Path to a python executable, or to a folder
#             containing `python.exe`, or the name of a conda-created
#             virtual environment prefixed by `conda://` (`conda://env_name`).
#             If empty, finds python from your windows %PATH%.
#       run (boolean): Creates the connection, and imports new
#             modules, when turned to True. Kills the connection,
#             and deletes the references to the imports, when turned
#             to False.
#       modules (str list): List of module names to import in the
#             remote python. They will be added to the
#             scriptcontext.sticky dictionary, allowing them to be
#             reused from other python components in the same
#             Grasshopper document. Submodules (for example
#             `numpy.linalg` have to be added explicitly to this list
#             to be available later.
#       log_level (str from ['NOTSET', 'DEBUG', 'INFO', 'WARNING', 'ERROR', 'CRITICAL']):
#             Logging level to use for the local IronPython and the
#             remote python instance.
#       working_dir (str): Working directory for the remote python
#             instance.
# 
# Returns:
#       out (str): Console output with DEBUG information.
#       linked_modules (str list): list of imported module names.
#       rpy (rpyc connection object): The object representing the
#             remote Python interpreter.
location = ClusterInput()  # location (str): Path to a python executable, or to a folder containing `python.exe`, or the name of a conda-created virtual environment prefixed by `conda://` (`conda://env_name`). If empty, finds python from your windows %PATH%.
run = ClusterInput()  # run (boolean): Creates the connection, and imports new modules, when turned to True. Kills the connection,and deletes the references to the imports, when turned to False.
modules = ClusterInput()  # modules (str list): List of module names to import in the remote python. They will be added to the scriptcontext.sticky dictionary, allowing them to be reused from other python components in the same Grasshopper document. Submodules (for example `numpy.linalg` have to be added explicitly to this list to be available later.
list = ValueList({"CRITICAL", "ERROR", "WARNING", "INFO", "DEBUG", "NOTSET"}, selected="DEBUG")
panel = Panel(python)
ghpythonremote = GHPythonRemote(location=location, run=run, modules=modules, log_level=list, working_dir=panel)  # -> out, linked_modules, rpy; inputs run: Boolean, modules: list
# ---------- ghpythonremote: Python ----------
import inspect
import logging
from os import path
import sys
from time import sleep

import scriptcontext

import ghpythonremote
from ghpythonremote.connectors import GrasshopperToPythonRemote
from Grasshopper.Kernel.GH_RuntimeMessageLevel import Error, Warning

local_log_level = getattr(logging, log_level, logging.WARNING)
logger = logging.getLogger("ghpythonremote")
logger.setLevel(local_log_level)
ch = logging.StreamHandler()
ch.setLevel(local_log_level)
formatter = logging.Formatter("%(levelname)s: %(name)s:\n%(message)s")
ch.setFormatter(formatter)
logger.handlers = []
logger.addHandler(ch)
logger = logging.getLogger("ghpythonremote.GH_to_python")

ROOT = path.abspath(path.dirname(inspect.getfile(ghpythonremote)))
rpyc_server_py = path.join(ROOT, "pythonservice.py")

cluster_comp = ghenv.Component.OnPingDocument().Owner

# Set connection to CLOSED if this is the first run
# and initialize set of linked modules
try:
    remote_python_status
except NameError:
    remote_python_status = "CLOSED"
    lkd_modules = set()

# Wait for connection to connect or terminate
timer = 0
while remote_python_status == "CONNECTING" or remote_python_status == "CLOSING":
    sleep(1)
    timer += 1
    if timer == 10:
        try:
            gh2py_manager.__exit__(*sys.exc_info())
        except Exception:
            pass
        remote_python_status = "CLOSED"
        lkd_modules = set()
        message = (
            "Connection left in an inconsistent state and not returning. Reset "
            "everything."
        )
        if cluster_comp is not None:
            cluster_comp.AddRuntimeMessage(Warning, message)
        raise RuntimeError(message)

if run:
    if not remote_python_status == "OPEN":
        remote_python_status = "CONNECTING"
        gh2py_manager = GrasshopperToPythonRemote(
            rpyc_server_py,
            location=location,
            timeout=10,
            port=None,
            log_level=log_level,
            working_dir=working_dir,
        )
        gh2py = gh2py_manager.__enter__()
        remote_python_status = "OPEN"

    # Stuff that we can reach
    rpymod = gh2py.py_remote_modules  # A getter function for a named python module
    rpy = gh2py.connection  # Represents the remote instance root object
    scriptcontext.sticky["rpy"] = rpy
    # Add modules
    for mod in modules:
        try:
            scriptcontext.sticky[mod] = rpymod(mod)
            lkd_modules.add(mod)
        except ImportError:
            gh2py_manager.__exit__(*sys.exc_info())
            if cluster_comp is not None:
                cluster_comp.AddRuntimeMessage(
                    Error,
                    'Could not import module "{}" in remote Python.'.format(mod)
                )
            raise
        except EOFError:
            if cluster_comp is not None:
                cluster_comp.AddRuntimeMessage(
                    Error,
                    'Remote Python has been closed unexpectedly'
                )
            raise

elif not remote_python_status == "CLOSED":
    remote_python_status = "CLOSING"
    # Remove linked modules
    for mod in lkd_modules:
        del scriptcontext.sticky[mod]
    del scriptcontext.sticky["rpy"]
    gh2py_manager.__exit__(*sys.exc_info())
    lkd_modules = set()
    remote_python_status = "CLOSED"

# Change variable name because ghpython resets outputs to None before each run
linked_modules = lkd_modules

logger.info("GH to python connection is {}".format(remote_python_status))
# ---------- end ghpythonremote ----------
out = ClusterOutput(ghpythonremote.out)  # Console output.
linked_modules = ClusterOutput(ghpythonremote.linked_modules)  # Names of modules that were successfully added to the scriptcontext.sticky dictionary.
rpy = ClusterOutput(ghpythonremote.rpy)  # The object representing the remote python instance
python_2 = PythonScript(module_names=ghpythonremote.linked_modules)  # -> import_statements; inputs module_names: list
# ---------- python_2: Python ----------
import_statements = ["import scriptcontext as sc"]
for module_name in module_names:
    import_statements.append("{0} = sc.sticky['{0}']".format(module_name))

if len(module_names) == 0:
    import_statements = []
# ---------- end python_2 ----------
import_statements = ClusterOutput(python_2)  # Useful import statements to use the imported modules in your scripts.

# ==== cluster ᔓᔕᙁᗩᴥᗩᑫᑭИNᗝᗩᔓᔕᗩᙏᙏᗩᔓᔕᗩᗝИNᑫᑭᗩᴥᗩᙁᔓᔕ_2

shift = ClusterInput()
relay = ClusterInput()
mass_addition = MassAddition(Input=relay)  # -> Result, PartialResults
shift_list = ShiftList(List=mass_addition.PartialResults, Shift=shift, Wrap=False)
relay_2 = ClusterOutput(shift_list)
result = ClusterOutput(mass_addition.Result)
format = Format(Format="{0:R}", Culture=127, Data0=shift_list)
panel = Panel(format)
format_2 = Format(Format="{0:R}", Culture=127, Data0=mass_addition.PartialResults)
panel_2 = Panel(format_2)
format_3 = Format(Format="{0:R}", Culture=127, Data0=relay)
panel_3 = Panel(format_3)
