# Grasshopper definition XHG..⠀⠀⠀⠀ⵙᗱᗴⵙᴥⵙᗱᗴⵙ옷ⵙߦⵙᔓᔕⵙ◯ⵙ✤ⵙᴥⵙᗩⵙ옷ⵙᑐᑕⵙ◯ⵙ人ⵙᑐᑕⵙИNⵙᗱᗴⵙᑎⵙ¤ⵙᗱᗴⵙᴥⵙꗳⵙ◯ⵙᴥⵙᗩⵙᙁⵙᗩⵙᑐᑕⵙᔓᔕⵙ⠀⠀⠀⠀◯⠀⠀⠀⠀ⵙ⠀⠀⠀⠀◯⠀⠀⠀⠀ⵙᔓᔕⵙᑐᑕⵙᗩⵙᙁⵙᗩⵙᴥⵙ◯ⵙꗳⵙᴥⵙᗱᗴⵙ¤ⵙᑎⵙᗱᗴⵙИNⵙᑐᑕⵙ人ⵙ◯ⵙᑐᑕⵙ옷ⵙᗩⵙᴥⵙ✤ⵙ◯ⵙᔓᔕⵙߦⵙ옷ⵙᗱᗴⵙᴥⵙᗱᗴⵙ⠀⠀⠀⠀..GHX (Grasshopper 1.0.7)
# plug-ins: Firefly.X, CurvePlus, TT Toolbox, Pancake, Wombat, Kangaroo2 Components, Pufferfish, NGon, Yellow, MeshEdit Components, IntraLattice, HoopSnake

panel = Panel("84.406022589954030768899117092091000289089388918088900852079")
evaluate = Evaluate(Expression="Format(\"{0:0.00000000}\", X)", X=panel)
number = Number(panel)
panel_2 = Panel("14")
panel_3 = Panel(evaluate)
panel_4 = Panel("84.406022589954030768899117092091000289089388918088900852079")
one_over_x = OneOverX(Value=Slider(25, range=1..65))
panel_5 = Panel(number)
series = Series(Start=0, Step=1, Count=379)
expression = Expression(O=series, Expression="((3^(1/3^3))^O)/84.406022589954030768899117092091000289089388918088900852079")
series_2 = Series(Start="0", Step="1", Count=Slider(351, range=1..1025))
power = Power(A=3, B=one_over_x)
power_2 = Power(A=power, B=series_2)
panel_6 = Panel(expression)
division = Division(A=panel_4, B=power_2)
multiplication = Multiplication(A=division, B="299792458")
graft_tree = GraftTree(Tree=multiplication, IncludeEmptyLists=True, IncludeNullItems=True)
graft_tree_2 = GraftTree(Tree=division, IncludeEmptyLists=True, IncludeNullItems=True)
division_2 = Division(A=power_2, B=panel_4)
graft_tree_3 = GraftTree(Tree=division_2, IncludeEmptyLists=True, IncludeNullItems=True)
evaluate_2 = Evaluate(Expression="Format(\"{0:0.0000000000000000}\", X)", X=expression)
panel_7 = Panel(evaluate_2)
power_3 = Power(A="9", B="2")
division_3 = Division(A=panel_4, B=power_3)
one_over_x_2 = OneOverX(Value=power_3)
construct_point = ConstructPoint(XCoordinate=0, YCoordinate=graft_tree_2, ZCoordinate=0)
panel_8 = Panel("""28160.0000000000000000 
26579.5006451166000000 
25087.7079028320000000 
23679.6430535447000000 
22350.6068117123000000 
21096.1636424237000000 
19912.1269582132000000 
18794.5451467141000000 
17739.6883825199000000 
16744.0361792384000000 
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""")
panel_9 = Panel([graft_tree_2, graft_tree_3, graft_tree])
panel_10 = Panel("""-0.0009967000000000 
-3.6736000000000000 
-0.0009967000000000 
-0.0009967000000000 
-0.0009967000000000 
-5.7216000000000000 
-0.0009967000000000 
-7.6629330000000000 
-11.1104000000000000 
-13.5850670000000000 
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""")
text_split = TextSplit(Text=panel_8, Separators=" ")
panel_11 = Panel(text_split)
numbers_to_points = NumbersToPoints(Numbers=panel_9, Mask=4)
digit_scroller = DigitScroller(Scroller_Digits=12, Scroller_Prefix="Digit Scroller", Scroller_Radix=11, Scroller_Value=243)
expression_2 = Expression(O=digit_scroller, Expression="((3^(1/3^3))^O)/84.406022589954030768899117092091000289089388918088900852079")
line = Line(StartPoint=Point(0, 0, 0), EndPoint=construct_point)
spiral_rail = SpiralRail(Curve=line, Angle=0, Turns=1, BaseRadius=construct_point, PeakRadius=construct_point, SamplePoint=256)
text_split_2 = TextSplit(Text=panel_10, Separators=" ")
panel_12 = Panel(text_split_2)
xz_plane = XZPlane(Origin=Point(0, 0, 0))
rotate = Rotate(Geometry=spiral_rail, Angle=1.570796327, Plane=xz_plane)  # -> Geometry, Transform
text_tag = TextTag(Location=construct_point, Text=numbers_to_points, Colour=RGB(212, 212, 212))
tone_generator = ToneGenerator(AudioFrequency=expression_2, Volume=one_over_x_2, Duration=division_3, Repeat=Toggle(False))
panel_13 = Panel(expression_2)
number_2 = Number(panel_12)
division_4 = Division(A=number_2, B=20)
power_4 = Power(A=10, B=division_4)
panel_14 = Panel(power_4)

xy_plane = XYPlane(Origin=Point(0, 0, 0))
yz_plane = YZPlane(Origin=Point(0, 0, 0))
xz_plane_2 = XZPlane(Origin=Point(0, 0, 0))
yz_plane_2 = YZPlane(Origin=Point(0, 0, 0))
number_slider = Slider(0, range=0..90)
rotate_direction = RotateDirection(Geometry=xz_plane_2, Center=Point(0, 0, 0), From=Vector(0, 100000, -100000), To=Vector(0, 0, -84641.0625))  # -> Geometry, Transform
rotate_direction_2 = RotateDirection(Geometry=yz_plane_2, Center=Point(0, 0, 0), From=Vector(75498.375, 0, 0), To=Vector(100000, 0, -100000))  # -> Geometry, Transform
plane_surface = PlaneSurface(Plane=xy_plane, XSize=Domain(-100000, 100000), YSize=Domain(-100000, 100000))
plane_surface_2 = PlaneSurface(
    Plane=[xz_plane_2, rotate_direction.Geometry, yz_plane_2, rotate_direction_2.Geometry],
    XSize=Domain(-100000, 100000),
    YSize=Domain(-100000, 100000))
sphere = Sphere(Base=yz_plane_2, Radius="50000")
reverse = Reverse(Vector=xy_plane)
plane_surface_3 = PlaneSurface(Plane=rotate_direction.Geometry, XSize=Domain(-100000, 100000), YSize=Domain(-100000, 100000))
plane_surface_4 = PlaneSurface(Plane=rotate_direction_2.Geometry, XSize=Domain(-100000, 100000), YSize=Domain(-100000, 100000))
surface_split = SurfaceSplit(Surface=sphere, Curves=plane_surface_2)
rotate_2 = Rotate(Geometry=plane_surface, Angle=1.570796327, Plane=yz_plane)  # -> Geometry, Transform
number_slider_2 = Slider(11, range=2..381)
radians = Radians(Degrees=-45)
construct_domain = ConstructDomain(DomainStart=0, DomainEnd=radians)
rotate_3 = Rotate(Geometry=rotate_2.Geometry, Angle=-1.570796327, Plane=PlaneXY(0, 0, 0))  # -> Geometry, Transform
list_item = ListItem(List=surface_split, Index=Slider(13, range=0..16), Wrap=False)
brep_brep = BrepBrep(BrepA=plane_surface_3, BrepB=plane_surface_4, UseTasks=False)  # -> Curves, Points
brep_edges = BrepEdges(Brep=list_item)  # -> Naked, Interior, NonManifold
number_slider_3 = Slider(27, range=0..512)
end_points = EndPoints(Curve=brep_edges.Naked)  # -> Start, End
data = Data([end_points.Start, end_points.End])
point = Point(Point(0, 0, 0))
list_item_2 = ListItem(List=data, Index=0, Wrap=False)
list_item_3 = ListItem(List=data, Index=2, Wrap=False)
mirror = Mirror(Geometry=list_item_3, Plane=xz_plane_2)  # -> Geometry, Transform
line_2 = Line(StartPoint=list_item_3, EndPoint=mirror.Geometry)
length = Length(Curve=line_2)
curve_middle = CurveMiddle(Curve=line_2)
line_3 = Line(StartPoint=Point(0, 0, 0), EndPoint=curve_middle)
division_5 = Division(A=length, B=2)
length_2 = Length(Curve=line_3)
negative = Negative(Value=length_2)
cone = Cone(Base=curve_middle, Radius=division_5, Length=negative)  # -> Cone, Tip
list_item_4 = ListItem(List=data, Index=3, Wrap=False)
list_item_5 = ListItem(List=data, Index=4, Wrap=False)

length_3 = Length(Curve=brep_edges.Naked)
list_item_6 = ListItem(List=length_3, Index=Slider(1, range=0..1), Wrap=False)
panel_15 = Panel(list_item_6)

scale = Scale(Geometry=cone.Cone, Center=Point(0, 0, 0), Factor=2)  # -> Geometry, Transform
point_2 = Point(flatten([point, list_item_4, list_item_5]))
point_3 = Point(flatten([list_item_2, point, list_item_3]))
_4point_surface = _4PointSurface(CornerA=point, CornerB=list_item_4, CornerC=list_item_5)
_4point_surface_2 = _4PointSurface(CornerA=point, CornerB=list_item_2, CornerC=list_item_3)
negative_2 = Negative(Value=construct_domain)
surface_split_2 = SurfaceSplit(Surface=sphere, Curves=scale.Geometry)
scale_2 = Scale(Geometry=[_4point_surface_2, _4point_surface], Center=Point(0, 0, 0), Factor=2)  # -> Geometry, Transform
range = Range(Domain=construct_domain, Steps=1)
brep_brep_2 = BrepBrep(BrepA=_4point_surface_2, BrepB=_4point_surface)  # -> Curves, Points
brep_plane = BrepPlane(Brep=list_item, Plane=scale_2.Geometry)  # -> graft(Curves), graft(Points)
list_item_7 = ListItem(List=surface_split_2, Index=1, Wrap=False)
rotate_4 = Rotate(Geometry=rotate_3.Geometry, Angle=range, Plane=xy_plane)  # -> Geometry, Transform
surface_split_3 = SurfaceSplit(Surface=list_item_7, Curves=rotate_4.Geometry)
number_slider_4 = Slider(2, range=2..10)
list_item_8 = ListItem(List=surface_split_3, Index=1, Wrap=False)
brep_edges_2 = BrepEdges(Brep=list_item_8)  # -> flatten(Naked), Interior, NonManifold
list_item_9 = ListItem(List=brep_edges_2.Naked, Index=0, Wrap=False)
number_slider_5 = Slider(0.479497, range=0..1)
subtraction = Subtraction(A=Slider(2, range=0..10), B=1)
remap_numbers = RemapNumbers(Source=Domain(0, 1), Target=Domain(0, 1))  # -> Mapped, Clipped
flip_curve = FlipCurve()  # -> Curve, Flag
length_4 = Length(Curve=list_item_9)
number_3 = Number(0)
list_item_10 = ListItem(List=brep_edges_2.Naked, Index=1, Wrap=False)
number_4 = Number(graft(0))
line_4 = Line(StartPoint=Point(0, 0, 0), EndPoint=Point(0, 0, 0))
surface = Surface(list_item_8)
end_points_2 = EndPoints(Curve=list_item_10)  # -> Start, End
point_4 = Point(end_points_2.End)
line_sdl = LineSDL(Start=point_4, Direction=Vector(0, -19054.8125, 0), Length=50000)
point_5 = Point(end_points_2.Start)
line_5 = Line(StartPoint=Point(0, 0, 0), EndPoint=point_5)
extend_curve = ExtendCurve(Curve=line_5, Type=0, Start=0, End=Slider(20710, range=0..111000))
curve_curve = CurveCurve(CurveA=line_sdl, CurveB=extend_curve)  # -> Points, ParamsA, ParamsB
line_6 = Line(StartPoint=Point(0, 0, 0), EndPoint=curve_curve.Points)
end_points_3 = EndPoints(Curve=extend_curve)  # -> Start, End
point_6 = Point(end_points_3.End)
rotate_direction_3 = RotateDirection(Geometry=line_6, Center=curve_curve.Points, From=Vector(35188.5, 0, 0), To=Vector(-32859.125, 0, 0))  # -> Geometry, Transform
point_7 = Point(Point(0, 0, 0))
end_points_4 = EndPoints(Curve=rotate_direction_3.Geometry)  # -> Start, End
point_8 = Point(end_points_4.Start)
line_7 = Line(StartPoint=Point(0, 0, 0), EndPoint=Point(0, 0, 0))
multiplication_2 = Multiplication()
line_8 = Line(StartPoint=Point(0, 0, 0), EndPoint=Point(0, 0, 0))
null_item = NullItem()  # -> NullFlags, InvalidFlags, Description
number_slider_6 = Slider(0, range=0..10000)
brep_edges_3 = BrepEdges(Brep=list_item)  # -> Naked, Interior, NonManifold
join_curves = JoinCurves(Curves=flatten(brep_edges_3.Naked), Preserve=False)  # -> flatten(Curves)
number_slider_7 = Slider(0.403042, range=0..1)
point_9 = Point([Point(2401.901761, 34427.10607, 34427.10607), Point(2456.715259, 34200.05045, 34200.05045), Point(2527.304717, 34197.47517, 34197.47517), Point(2632.236914, 34643.8313, 34643.8313), Point(2668.450942, 34192.10577, 34192.10577), Point(2739.007108, 34189.31169, 34189.31169)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])
digit_scroller_2 = DigitScroller(Scroller_Digits=12, Scroller_Prefix="Index", Scroller_Radix=11, Scroller_Value=217)
pi = Pi(Factor=2)
digit_scroller_3 = DigitScroller(Scroller_Digits=12, Scroller_Prefix="Digit Scroller", Scroller_Radix=11, Scroller_Value=150)
digit_scroller_4 = DigitScroller(Scroller_Digits=12, Scroller_Prefix="Digit Scroller", Scroller_Radix=11, Scroller_Value=1)
pi_2 = Pi(Factor=2)
relay = Relay()
digit_scroller_5 = DigitScroller(Scroller_Digits=12, Scroller_Prefix="Digit Scroller", Scroller_Radix=2, Scroller_Value=11.1728)
number_slider_8 = Slider(186, range=0..378)
digit_scroller_6 = DigitScroller(Scroller_Digits=12, Scroller_Prefix="Digit Scroller", Scroller_Radix=3, Scroller_Value=14)
digit_scroller_7 = DigitScroller(Scroller_Digits=12, Scroller_Prefix="Digit Scroller", Scroller_Radix=3, Scroller_Value=27)
panel_16 = Panel("1-(-COS(4*ATAN(1)*O*2*((((OO)))))/2+.5)*((((1/OOO))))")
division_6 = Division(A=1, B=2.2)
panel_17 = Panel("(1-(-ASIN(COS(4*ATAN(1)*O*2*((((OO))))))/(4*ATAN(1))+.5)*((((1/OOO)))))")
series_3 = Series(Start=0, Step=0, Count=379)
deconstruct_matrix = DeconstructMatrix()  # -> Rows, Columns, Values
addition = Addition(A=series_3, B=1)
cull_nth = CullNth(List=addition, CullFrequency=3)
panel_18 = Panel(addition)
digit_scroller_8 = DigitScroller(Scroller_Digits=12, Scroller_Prefix="Digit Scroller", Scroller_Radix=11, Scroller_Value=0)
number_5 = Number([4, 1, 1, 2, 1, 1, 2, 1, 1, 3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])
multiplication_3 = Multiplication(A=number_5, B=Slider(9, range=0..243))
number_slider_9 = Slider(1, range=0..16)
list_item_11 = ListItem(Index=1, Wrap=False)
loft_options = LoftOptions(Closed=False, Adjust=False, Rebuild=0, Refit=0, Type=0)
digit_scroller_9 = DigitScroller(Scroller_Digits=12, Scroller_Prefix="Scale", Scroller_Radix=11, Scroller_Value=142)
yz_plane_3 = YZPlane(Origin=Point(0, 0, 0))
number_slider_10 = Slider(3, range=0..10)
number_slider_11 = Slider(10000, range=0..10000)
negative_3 = Negative(Value=number_slider_11)
construct_domain_2 = ConstructDomain(DomainStart=negative_3, DomainEnd=number_slider_11)
plane_surface_5 = PlaneSurface(Plane=yz_plane_3, XSize=construct_domain_2, YSize=construct_domain_2)
division_7 = Division(A=number_slider_11, B=2)
sqrt_2 = Panel("(3.14124523291+3.14124523248)/2")
digit_scroller_10 = DigitScroller(Scroller_Digits=12, Scroller_Prefix="Digit Scroller", Scroller_Radix=1, Scroller_Value=3.14023634)
division_8 = Division(A=number_slider_11, B=2)
infoglasses = InfoGlasses(Run=True, Language=0, cateSet=False, showName=False)
panel_19 = Panel("3.14023634018")
number_slider_12 = Slider(1, range=1..27)
stream_filter = StreamFilter(Gate=Slider(0, range=0..1), Stream0=panel_19, Stream1=sqrt_2)
line_sdl_2 = LineSDL(Start=Point(0, 0, 0), Direction=Vector(0, 0, 1), Length=number_slider_11)
curve_middle_2 = CurveMiddle(Curve=line_sdl_2)
rotate_direction_4 = RotateDirection(Geometry=line_sdl_2, Center=curve_middle_2, From=Vector(0, 0, 9873.875), To=Vector(0, 1, 0))  # -> Geometry, Transform
evaluate_length = EvaluateLength(Curve=line_sdl_2, Length=0, Normalized=True)  # -> Point, Tangent, Parameter
division_9 = Division(A=division_7, B=stream_filter)
number_slider_13 = Slider(0.0001, range=0..0.0001)
multiplication_4 = Multiplication(A=number_slider_12, B=6)

length_5 = Length(Curve=line_sdl_2)
panel_20 = Panel(length_5)

radians_2 = Radians(Degrees=Slider(0, range=0..360))
multiplication_5 = Multiplication(A=division_9, B=1)
circle_cnr = CircleCNR(Center=evaluate_length.Point, Normal=evaluate_length.Tangent, Radius=multiplication_5)

length_6 = Length(Curve=circle_cnr)
panel_21 = Panel(length_6)

evaluate_length_2 = EvaluateLength(Curve=circle_cnr, Length=Slider(0, range=0..1), Normalized=True)  # -> Point, Tangent, Parameter
multiplication_6 = Multiplication(A=number_slider_12, B=8)
point_10 = Point(Point(0, 0, 0))
arc = Arc(Plane=point_10, Radius=Slider(10000, range=0..10000), Angle=Domain(0, 1.570796327))  # -> Arc, Length
digit_scroller_11 = DigitScroller(Scroller_Digits=12, Scroller_Prefix="Digit Scroller", Scroller_Radix=1, Scroller_Value=2)
subtraction_2 = Subtraction(B=1)
point_11 = Point(Point(1360.6875, -3377.5, 0))

digit_scroller_12 = DigitScroller(Scroller_Digits=12, Scroller_Prefix="Digit Scroller", Scroller_Radix=2, Scroller_Value=1.414261775)
panel_22 = Panel("1.4142617748")

division_10 = Division(A=multiplication_5, B=digit_scroller_11)
spiral_rail_2 = SpiralRail(
    Curve=line_sdl_2,
    Angle=radians_2,
    Turns=number_slider_12,
    BaseRadius=multiplication_5,
    PeakRadius=multiplication_5,
    SamplePoint=16)

digit_scroller_13 = DigitScroller(Scroller_Digits=12, Scroller_Prefix="Digit Scroller", Scroller_Radix=1, Scroller_Value=1.206966296)
panel_23 = Panel("1.20696629629")

c_script = CSharpScript(
    railCurve=line_sdl_2,
    t0=0,
    t1=1,
    radiusPoint=evaluate_length_2.Point,
    pitch=0,
    turnCount=number_slider_12,
    radius0=multiplication_5,
    radius1=multiplication_5)  # -> out, A; inputs railCurve: Curve, t0: Double, t1: Double, radiusPoint: Point3d, pitch: Double, turnCount: Double, radius0: Double, radius1: Double
# ---------- c_script: C# ----------
    int pointsPerTurn = 12;

    if (railCurve == null) return;
    A = NurbsCurve.CreateSpiral(
      railCurve,
      t0,
      t1,
      radiusPoint,
      pitch,
      turnCount,
      radius0,
      radius1,
      pointsPerTurn);
# ---------- end c_script ----------
length_7 = Length(Curve=c_script.A)
panel_24 = Panel(length_7)
division_11 = Division(A=panel_24, B=panel_20)
panel_25 = Panel(division_11)

division_12 = Division(A=panel_25, B="SQRT(2)")
panel_26 = Panel(division_12)

divide_curve = DivideCurve(Curve=c_script.A, Count=2, Kinks=False)  # -> Points, Tangents, Parameters
sift_pattern = SiftPattern(List=divide_curve.Points, SiftPattern=[0, 1, 2])  # -> flatten(Output0), flatten(Output1), flatten(Output2)
clean_tree = CleanTree(RemoveNulls=True, RemoveInvalid=True, RemoveEmpty=False, Tree=sift_pattern.Output0)
clean_tree_2 = CleanTree(RemoveNulls=True, RemoveInvalid=True, RemoveEmpty=False, Tree=sift_pattern.Output2)
clean_tree_3 = CleanTree(RemoveNulls=True, RemoveInvalid=True, RemoveEmpty=False, Tree=sift_pattern.Output1)
_4point_surface_3 = _4PointSurface(CornerA=clean_tree, CornerB=clean_tree_3, CornerC=clean_tree_2)

evaluate_length_3 = EvaluateLength(Curve=c_script.A, Length=0, Normalized=True)  # -> Point, Tangent, Parameter

project = Project(Curve=c_script.A, Brep=plane_surface_5, Direction=Vector(3989, 0, 0))
length_8 = Length(Curve=project)
panel_27 = Panel(length_8)
division_13 = Division(A=panel_27, B=panel_20)
panel_28 = Panel(division_13)

curvature_graph = CurvatureGraph(Curve=project, Density=1, Scale=digit_scroller_9)

divide_curve_2 = DivideCurve(Curve=project, Count=Slider(16, range=0..16), Kinks=False)  # -> Points, Tangents, graft(Parameters)
curvature = Curvature(Curve=project, Parameter=divide_curve_2.Parameters)  # -> Point, Curvature, Curvature_2
deconstruct_arc = DeconstructArc(Arc=curvature.Curvature_2)  # -> BasePlane, Radius, Angle
line_9 = Line(StartPoint=divide_curve_2.Points, EndPoint=deconstruct_arc.BasePlane)  # -> graft(Line)
scale_3 = Scale(Geometry=line_9, Center=graft(divide_curve_2.Points), Factor=-1)  # -> Geometry, Transform
end_points_5 = EndPoints(Curve=scale_3.Geometry)  # -> Start, End
point_12 = Point(end_points_5.End)
interpolate = Interpolate(Vertices=flatten(point_12), Degree=Slider(1, range=1..11), Periodic=False, KnotStyle=0)  # -> Curve, Length, Domain

evaluate_curve = EvaluateCurve(Curve=project, Parameter=divide_curve_2.Parameters)  # -> Point, Tangent, Angle
evaluate_length_4 = EvaluateLength(Curve=project, Length=0.5, Normalized=True)  # -> Point, Tangent, Parameter
line_sdl_3 = LineSDL(Start=evaluate_length_4.Point, Direction=evaluate_length_4.Tangent, Length=division_8)
angle = Angle(VectorA=Vector(0, 0, 7559.625), VectorB=line_sdl_3)  # -> Angle, Reflex

digit_scroller_14 = DigitScroller(Scroller_Digits=12, Scroller_Prefix="Digit Scroller", Scroller_Radix=11, Scroller_Value=16)
digit_scroller_15 = DigitScroller(Scroller_Digits=12, Scroller_Prefix="Digit Scroller", Scroller_Radix=11, Scroller_Value=120)
curvature_graph_2 = CurvatureGraph(Curve=interpolate.Curve, Density=digit_scroller_14, Scale=digit_scroller_15)

derivatives = Derivatives(Curve=project, Parameter=divide_curve_2.Parameters)  # -> Point, FirstDerivative, SecondDerivative, ThirdDerivative, FourthDerivative, FifthDerivative, SixthDerivative
degrees = Degrees(Radians=angle.Angle)
panel_29 = Panel(degrees)
panel_30 = Panel(derivatives.SecondDerivative)
line_sdl_4 = LineSDL(Start=derivatives.Point, Direction=derivatives.SecondDerivative, Length=Slider(2950, range=0..10000))
divide_curve_3 = DivideCurve(Curve=c_script.A, Count=multiplication_6, Kinks=False)  # -> Points, Tangents, Parameters
circle_cnr_2 = CircleCNR(Center=divide_curve_3.Points, Normal=_4point_surface_3, Radius=division_9)
circle_cnr_3 = CircleCNR(Center=evaluate_length_3.Point, Normal=evaluate_length_3.Tangent, Radius=division_10)
number_slider_14 = Slider(1005, range=0..10000)
evaluate_length_5 = EvaluateLength(Curve=circle_cnr_3, Length=Slider(0.237188, range=0..1), Normalized=True)  # -> Point, Tangent, Parameter
division_14 = Division(A=panel_20, B=panel_27)
division_15 = Division(A=panel_20, B=panel_24)
panel_31 = Panel(division_14)
multiplication_7 = Multiplication(A=digit_scroller_13, B=digit_scroller_12)
multiplication_8 = Multiplication(A=number_slider_12, B=4)
offset_curve = OffsetCurve(Curve=circle_cnr_2, Distance=number_slider_14, Plane=PlaneXY(0, 0, 0), Corners=2)
panel_32 = Panel(division_15)
multiplication_9 = Multiplication(A=number_slider_12, B=4)
addition_2 = Addition(A=multiplication_6, B=1)
series_4 = Series(Start=division_9, Step=0, Count=addition_2)
negative_4 = Negative(Value=number_slider_14)
trim_tree = TrimTree(Tree=offset_curve, Depth=1)
division_16 = Division(A=panel_28, B=panel_25)
division_17 = Division(A=panel_25, B=panel_28)
divide_curve_4 = DivideCurve(Curve=c_script.A, Count=multiplication_9, Kinks=False)  # -> Points, Tangents, Parameters; disabled
list_length = ListLength(List=flatten(series_4))
c_script_2 = CSharpScript(
    railCurve=spiral_rail_2,
    t0=0,
    t1=1,
    radiusPoint=evaluate_length_5.Point,
    pitch=Slider(0.099864, range=0..1),
    turnCount=multiplication_8,
    radius0=division_10,
    radius1=division_10)  # -> out, A; inputs railCurve: Curve, t0: Double, t1: Double, radiusPoint: Point3d, pitch: Double, turnCount: Double, radius0: Double, radius1: Double; same code as c_script
spiral_rail_3 = SpiralRail(Curve=spiral_rail_2, Angle=0, Turns=multiplication_7, BaseRadius=division_10, PeakRadius=division_10, SamplePoint=100)
division_18 = Division(A=series_4, B=9)
region_union = RegionUnion(Curves=trim_tree)
panel_33 = Panel(division_16)
panel_34 = Panel(division_17)
curve_domain = CurveDomain(Curve=c_script.A)  # -> Curve, Domain
offset_curve_2 = OffsetCurve(Curve=region_union, Distance=negative_4, Plane=PlaneXY(0, 0, 0), Corners=Slider(2, range=2..3))
division_19 = Division(A=list_length, B=2)
deconstruct_domain = DeconstructDomain(Domain=curve_domain.Domain)  # -> Start, End
list_length_2 = ListLength()
range_2 = Range(Domain=Domain(0, 1), Steps=multiplication_6)
subtraction_3 = Subtraction(A=division_19, B=1)
series_5 = Series(Start=1, Step=2, Count=subtraction_3)
list_item_12 = ListItem(List=flatten(division_18), Index=series_5, Wrap=True)
replace_items = ReplaceItems(List=flatten(series_4), Item=flatten(list_item_12), Indices=flatten(series_5), Wrap=False)
circle_cnr_4 = CircleCNR(Center=flatten(divide_curve_3.Points), Normal=flatten(divide_curve_3.Tangents), Radius=replace_items)
subtraction_4 = Subtraction(A=list_length_2, B=2)
multiplication_10 = Multiplication(A=range_2, B=deconstruct_domain.End)
pipe_variable = PipeVariable(Curve=c_script.A, Parameters=multiplication_10, Radii=replace_items, Caps=2)  # disabled
panel_35 = Panel()
list_item_13 = ListItem(List=panel_35, Index=0, Wrap=True)
panel_36 = Panel(list_item_13)

file_path = FilePath("C:\ƧLX...⠀⠀⠀⠀ⵙ✤ᴥᗩ옷ᑐᑕⵙᗝᙁⓄ옷ᔓᔕᗱᗴᴥ옷✤ⵙ人✤ꖴᙁᗩꖴИNᗱᗴᕤᕦИNⓄᑐᑕⵙ人ᑐᑕИNᗱᗴᑎ¤ᗱᗴᴥꗳⵙ⠀⠀⠀⠀◯⠀⠀⠀⠀ⵙ⠀⠀⠀⠀◯⠀⠀⠀⠀ⵙꗳᴥᗱᗴ¤ᑎᗱᗴИNᑐᑕ人ⵙᑐᑕⓄИNᕤᕦᗱᗴИNꖴᗩᙁꖴ✤人ⵙ✤옷ᴥᗱᗴᔓᔕ옷Ⓞᙁᗝⵙᑐᑕ옷ᗩᴥ✤ⵙ⠀⠀⠀⠀...XLS")
worksheet_name = WorksheetName("ⵙⓄᴥߦⵙⵔⵔⵘⵈⵙ옷ᴥⵙ◯ⵙ◯ⵙᴥ옷ⵙⵈⵘⵔⵔⵙߦᴥⓄⵙ")
number_slider_15 = Slider(0, range=0..1)
file_path_2 = FilePath("C:\ƧLX...⠀⠀⠀⠀ⵙ✤ᴥᗩ옷ᑐᑕⵙᗝᙁⓄ옷ᔓᔕᗱᗴᴥ옷✤ⵙ人✤ꖴᙁᗩꖴИNᗱᗴᕤᕦИNⓄᑐᑕⵙ人ᑐᑕИNᗱᗴᑎ¤ᗱᗴᴥꗳⵙ⠀⠀⠀⠀◯⠀⠀⠀⠀ⵙ⠀⠀⠀⠀◯⠀⠀⠀⠀ⵙꗳᴥᗱᗴ¤ᑎᗱᗴИNᑐᑕ人ⵙᑐᑕⓄИNᕤᕦᗱᗴИNꖴᗩᙁꖴ✤人ⵙ✤옷ᴥᗱᗴᔓᔕ옷Ⓞᙁᗝⵙᑐᑕ옷ᗩᴥ✤ⵙ⠀⠀⠀⠀...XLS")
worksheet_name_2 = WorksheetName("ⵙⓄᴥߦⵙⵔⵔⵘⵈⵙ옷ᴥⵙ◯ⵙ◯ⵙᴥ옷ⵙⵈⵘⵔⵔⵙߦᴥⓄⵙ")
read_excel_sheet = ReadExcelSheet(Run=True, FilePath=file_path, Worksheet="1", Listen=False)  # -> UserMessages, Columns, Rows
read_excel_sheet_2 = ReadExcelSheet(Run=True, FilePath=file_path_2, Worksheet="2", Listen=False)  # -> UserMessages, Columns, Rows
data_2 = Data(read_excel_sheet.Columns)
panel_37 = Panel(data_2)
data_3 = Data(read_excel_sheet_2.Columns)
panel_38 = Panel(data_3)
explode_tree = ExplodeTree(Data=panel_37)  # -> Branch0, Branch1, Branch2, Branch3, Branch4, Branch5
explode_tree_2 = ExplodeTree(Data=panel_38)  # -> Branch0, Branch1, Branch2, Branch3, Branch4, Branch5
cull_index = CullIndex(List=explode_tree.Branch4, Indices=[0, 1, 2, 3, 4], Wrap=True)
cull_index_2 = CullIndex(List=explode_tree.Branch2, Indices=[0, 1, 2, 3, 4], Wrap=True)
cull_index_3 = CullIndex(List=explode_tree_2.Branch1, Indices=[0, 1, 2, 3], Wrap=True)
cull_index_4 = CullIndex(List=explode_tree_2.Branch0, Indices=[0, 1, 2, 3], Wrap=True)
panel_39 = Panel(cull_index)
panel_40 = Panel(cull_index_2)
panel_41 = Panel(cull_index_3)
panel_42 = Panel(cull_index_4)
stream_filter_2 = StreamFilter(Gate=number_slider_15, Stream0=panel_39, Stream1=panel_41)
stream_filter_3 = StreamFilter(Gate=number_slider_15, Stream0=panel_40, Stream1=panel_42)
number_6 = Number(stream_filter_2)
panel_43 = Panel("FORMAT(\"{0:0.0000000000000000000}\",O)")
number_7 = Number(stream_filter_3)
evaluate_3 = Evaluate(Expression=panel_43, O=number_6)
panel_44 = Panel(number_7)
evaluate_4 = Evaluate(Expression=panel_43, O=number_7)
number_8 = Number(evaluate_3)
panel_45 = Panel(evaluate_3)
panel_46 = Panel(evaluate_4)
list_length_3 = ListLength(List=panel_45)
stream_gate = StreamGate(Stream=panel_46, Gate=number_slider_15)  # -> Target0, Target1, Target2
logarithm = Logarithm(Value=stream_gate.Target0)
multiplication_11 = Multiplication(A=logarithm, B=20)
panel_47 = Panel(multiplication_11)
panel_48 = Panel(logarithm)
subtraction_5 = Subtraction(A=list_length_3, B=1)
number_slider_16 = Slider(100, range=0..100)
stream_filter_4 = StreamFilter(Gate=number_slider_15, Stream0=panel_47, Stream1=stream_gate.Target1, Stream2=stream_gate.Target2)
list_item_14 = ListItem(List=panel_45, Index=subtraction_5, Wrap=True)
list_item_15 = ListItem(List=panel_45, Index=0, Wrap=True)
construct_domain_3 = ConstructDomain(DomainStart=list_item_14, DomainEnd=list_item_15)
range_3 = Range(Domain=construct_domain_3, Steps=subtraction_5)
list_item_16 = ListItem(List=range_3, Index=0, Wrap=True)
list_item_17 = ListItem(List=range_3, Index=1, Wrap=True)
subtraction_6 = Subtraction(A=list_item_17, B=list_item_16)
division_20 = Division(A=subtraction_6, B=4)
multiplication_12 = Multiplication(A=division_20, B=2)
panel_49 = Panel(range_3)
number_slider_17 = Slider(1, range=0..256)
panel_50 = Panel(division_20)
construct_point_2 = ConstructPoint(XCoordinate=panel_49, YCoordinate=0, ZCoordinate=0)
number_slider_18 = Slider(0, range=0..90)
range_4 = Range(Domain=Domain(0, 1), Steps=Slider(8, range=1..10))
sphere_2 = Sphere(Base=construct_point_2, Radius=division_20)
range_5 = Range(Domain=Domain(0, 1), Steps=Slider(1, range=1..11))
number_slider_19 = Slider(2, range=0..10)
number_slider_20 = Slider(2, range=0..10)
number_9 = Number([2, 4])
number_10 = Number(263.7690326)
multiplication_13 = Multiplication(A=stream_filter_4, B=number_10)
panel_51 = Panel(multiplication_13)
line_sdl_5 = LineSDL(Start=construct_point_2, Direction=Vector(0, 14645.1875, 0), Length=multiplication_13)
mesh_pipe = MeshPipe(Curve=line_sdl_5, Radius=division_20, Segments=Slider(8, range=0..10), Accuracy=1, CapType=3, Faceted=False)
mesh_explode = MeshExplode(Mesh=mesh_pipe, Interpolate=False)
list_item_18 = ListItem(List=line_sdl_5, Index=Slider(138, range=0..378), Wrap=True)
pipe = Pipe(Curve=line_sdl_5, Radius=division_20, Caps=2)
parameter_pipe_mesh = ParameterPipeMesh(
    Curve=line_sdl_5,
    Radius=division_20,
    ParametersU=range_5,
    ParametersV=range_4,
    Weighted=False,
    Lengths=False,
    Angle=0,
    Rotation=0,
    EndType=2,
    Triangulate=False)
panel_52 = Panel(panel_51)
panel_53 = Panel(line_sdl_5)
panel_54 = Panel(mesh_pipe)
bounding_box = BoundingBox(Content=line_sdl_5, Plane=PlaneXY(0, 0, 0), UnionBox=True)  # -> Box, Box_2
cad_exporter = CADExporter(Export=False, ExportType="DXF", FilePaths="C:\", FileNames="FXD.DXF", Curves=line_sdl_5)
mesh_explode_2 = MeshExplode(Mesh=parameter_pipe_mesh, Interpolate=False)
panel_55 = Panel(parameter_pipe_mesh)
ellipse = Ellipse(Plane=construct_point_2, Radius1=division_20, Radius2=panel_52)  # -> Ellipse, Focus1, Focus2
scale_nu = ScaleNU(Geometry=ellipse.Ellipse, Plane=construct_point_2, ScaleX=1, ScaleY=number_9, ScaleZ=1)  # -> Geometry, Transform
deconstruct_box = DeconstructBox(Box=bounding_box.Box)  # -> Plane, X, Y, Z
deconstruct_domain_2 = DeconstructDomain(Domain=deconstruct_box.X)  # -> Start, End
bounding_box_2 = BoundingBox(Content=ellipse.Ellipse, Plane=PlaneXY(0, 0, 0))  # -> Box, Box_2
deconstruct_domain_3 = DeconstructDomain(Domain=deconstruct_box.Y)  # -> Start, End
stream_filter_5 = StreamFilter(Gate=Slider(0, range=0..1), Stream0=mesh_pipe, Stream1=parameter_pipe_mesh)
deconstruct_box_2 = DeconstructBox(Box=bounding_box_2.Box)  # -> Plane, X, Y, Z
deconstruct_domain_4 = DeconstructDomain(Domain=deconstruct_box_2.X)  # -> Start, End
subtraction_7 = Subtraction(A=deconstruct_domain_4.End, B=deconstruct_domain_4.Start)
panel_56 = Panel(subtraction_7)
absolute = Absolute(Value=deconstruct_domain_2.End)
absolute_2 = Absolute(Value=deconstruct_domain_2.Start)
absolute_3 = Absolute(Value=deconstruct_domain_3.Start)
absolute_4 = Absolute(Value=deconstruct_domain_3.End)
deconstruct_domain_5 = DeconstructDomain(Domain=deconstruct_box_2.Y)  # -> Start, End
addition_3 = Addition(A=absolute_2, B=absolute)
addition_4 = Addition(A=absolute_3, B=absolute_4)
vector_xyz = VectorXYZ(XComponent=0, YComponent=deconstruct_domain_5.Start, ZComponent=0)  # -> Vector, Length
move = Move(Geometry=ellipse.Ellipse, Motion=vector_xyz.Vector)  # -> Geometry, Transform
rotate_direction_5 = RotateDirection(Geometry=move.Geometry, Center=construct_point_2, From=Vector(2973.3125, 0, 0), To=Vector(0, 0, -1425.375))  # -> Geometry, Transform
divide_curves_on_intersects = DivideCurvesOnIntersects(Curves=[move.Geometry, rotate_direction_5.Geometry], Tolerance=0)
list_length_4 = ListLength(List=divide_curves_on_intersects)
division_21 = Division(A=list_length_4, B=2)
construct_domain_4 = ConstructDomain(DomainStart=0, DomainEnd=division_21)
subtraction_8 = Subtraction(A=division_21, B=1)
division_22 = Division(A=addition_4, B=addition_3)
division_23 = Division(A=addition_3, B=addition_4)
range_6 = Range(Domain=subtraction_8, Steps=subtraction_8)
cull_index_5 = CullIndex(List=divide_curves_on_intersects, Indices=range_6, Wrap=True)
cull_nth_2 = CullNth(List=cull_index_5, CullFrequency=2)
panel_57 = Panel(division_23)
panel_58 = Panel(division_22)
list_item_19 = ListItem(List=cull_nth_2, Index=Slider(65, range=0..378), Wrap=True)
curve = Curve(cull_nth_2)
end_points_6 = EndPoints(Curve=curve)  # -> Start, End
panel_59 = Panel(cull_nth_2)
line_10 = Line(StartPoint=end_points_6.Start, EndPoint=end_points_6.End)
revolution = Revolution(Curve=curve, Axis=line_10, Domain=Domain(0, 6.283185307))
bounding_box_3 = BoundingBox(Content=revolution, Plane=PlaneXY(0, 0, 0), UnionBox=True)  # -> Box, Box_2
brep = Brep(revolution)
group = Group(Objects=brep)

subtraction_9 = Subtraction(A=list_length_3, B=1)
range_7 = Range(Domain=construct_domain, Steps=subtraction_9)
negative_5 = Negative(Value=panel_42)
bounds = Bounds(Numbers=panel_42)
rotate_5 = Rotate(Geometry=rotate_2.Geometry, Angle=range_7, Plane=yz_plane)  # -> Geometry, Transform
brep_plane_2 = BrepPlane(Brep=list_item, Plane=rotate_5.Geometry)  # -> graft(Curves), graft(Points); disabled
negative_6 = Negative(Value=bounds)
remap_numbers_2 = RemapNumbers(Value=negative_5, Source=negative_6, Target=Domain(0, 1))  # -> flatten(Mapped), Clipped
negative_7 = Negative(Value=stream_filter_4)
end_points_7 = EndPoints(Curve=brep_plane_2.Curves)  # -> Start, End
curve_length_at = CurveLengthAt(Curve=brep_plane_2.Curves, Point=remap_numbers_2.Mapped, Normalized=False)  # -> Length, Parameter
multiplication_14 = Multiplication(A=negative_7, B=number_slider_3)  # -> graft(Result)
multiplication_15 = Multiplication(A=negative_7, B=number_slider_3)  # -> reverse(graft(Result))
negative_8 = Negative(Value=multiplication_15)
negative_9 = Negative(Value=multiplication_14)

list_length_5 = ListLength(List=panel_49)
data_4 = Data(0)
subtraction_10 = Subtraction(A=list_length_5, B=1)
list_item_20 = ListItem(List=construct_point_2, Index=subtraction_10, Wrap=False)  # -> flatten(Item)
list_item_21 = ListItem(List=construct_point_2, Index=data_4, Wrap=False)  # -> flatten(Item)
line_11 = Line(StartPoint=list_item_21, EndPoint=list_item_20)
length_9 = Length(Curve=line_11)
panel_60 = Panel(length_9)

scale_to_length = ScaleToLength(
    Curve=brep_plane_2.Curves,
    Plane=[end_points_7.Start, end_points_7.End],
    Length=[multiplication_14, multiplication_15],
    FactorX=1,
    FactorY=1,
    FactorZ=1)  # -> Scaled, Transform
division_24 = Division(A=panel_15, B=panel_60)
mirror_2 = Mirror(Geometry=scale_to_length.Scaled, Plane=_4point_surface)  # -> Geometry, Transform
data_5 = Data(flatten([scale_to_length.Scaled, mirror_2.Geometry]))
multiplication_16 = Multiplication(A=division_20, B=division_24)
offset_on_srf = OffsetOnSrf(Curve=data_5, Distance=1e-10, Surface=list_item)  # -> flatten(Curve); disabled
project_2 = Project(Curve=data_5, Brep=list_item, Direction=brep_brep_2.Curves)
mirror_3 = Mirror(Geometry=offset_on_srf, Plane=yz_plane)  # -> Geometry, Transform

addition_5 = Addition(A=subtraction_9, B=2)
range_8 = Range(Domain=construct_domain, Steps=addition_5)
rotate_6 = Rotate(Geometry=rotate_3.Geometry, Angle=range_8, Plane=xy_plane)  # -> Geometry, Transform

mesh_pipe_2 = MeshPipe(Curve=offset_on_srf, Radius=multiplication_16, Segments=8, Accuracy=1, CapType=3, Faceted=False)  # -> flatten(Mesh)
polar_array = PolarArray(Geometry=offset_on_srf, Plane=brep_brep.Curves, Count=3, Angle=6.283185307)  # -> flatten(Geometry), Transform
mirror_4 = Mirror(Geometry=[offset_on_srf, mirror_3.Geometry], Plane=xz_plane_2)  # -> Geometry, Transform
join_curves_2 = JoinCurves(Curves=[offset_on_srf, mirror_3.Geometry, mirror_4.Geometry], Preserve=False)  # -> flatten(Curves)
mesh_join = MeshJoin(Meshes=mesh_pipe_2)
mirror_5 = Mirror(Geometry=join_curves_2, Plane=xy_plane)  # -> Geometry, Transform
brep_plane_3 = BrepPlane(Brep=list_item_8, Plane=rotate_6.Geometry)  # -> Curves, Points
curve_2 = Curve(brep_plane_3.Curves)
curve_domain_2 = CurveDomain(Curve=curve_2)  # -> Curve, Domain
length_10 = Length(Curve=curve_2)
deconstruct_domain_6 = DeconstructDomain(Domain=curve_domain_2.Domain)  # -> Start, End
multiplication_17 = Multiplication(A=Slider(0.2, range=0..1), B=length_10)
brep_brep_3 = BrepBrep(BrepA=list_item_8, BrepB=rotate_6.Geometry)  # -> Curves, Points; disabled
evaluate_length_6 = EvaluateLength(Curve=curve_2, Length=multiplication_17, Normalized=False)  # -> Point, Tangent, Parameter
end_points_8 = EndPoints(Curve=brep_plane_3.Curves)  # -> Start, End

range_9 = Range(Domain=Domain(0, 1), Steps=Slider(8, range=1..10))
range_10 = Range(Domain=Domain(0, 1), Steps=Slider(4, range=1..11))
parameter_pipe_mesh_2 = ParameterPipeMesh(
    Curve=offset_on_srf,
    Radius=multiplication_16,
    ParametersU=range_10,
    ParametersV=range_9,
    Weighted=True,
    Lengths=False,
    Angle=0,
    Rotation=0,
    EndType=2,
    Triangulate=False)  # -> flatten(Piped)
mesh_join_2 = MeshJoin(Meshes=parameter_pipe_mesh_2)
panel_61 = Panel(mesh_join_2)

flatten_tree = FlattenTree(Tree=negative_7, Path="{0}")
division_25 = Division(A=length_4, B=panel_60)
point_13 = Point(end_points_8.End)
addition_6 = Addition(A=subtraction_9, B=1)
panel_62 = Panel(deconstruct_domain_6.End)
rotate_7 = Rotate(Geometry=[join_curves_2, mirror_5.Geometry], Angle=1.570796327, Plane=xz_plane_2)  # -> Geometry, Transform
relay_2 = Relay([number_3, addition_6])
join_curves_3 = JoinCurves(Curves=flatten(polar_array.Geometry), Preserve=False)  # -> flatten(Curves)
rotate_8 = Rotate(Geometry=[join_curves_2, mirror_5.Geometry], Angle=1.570796327, Plane=yz_plane)  # -> Geometry, Transform
join_curves_4 = JoinCurves(Curves=[join_curves_2, mirror_5.Geometry, rotate_8.Geometry, rotate_7.Geometry], Preserve=False)  # -> flatten(Curves)
multiplication_18 = Multiplication(A=division_20, B=division_25)
curve_3 = Curve(polar_array.Geometry)

insert_items = InsertItems(List=flatten(flatten_tree), Item=flatten(number_3), Indices=flatten(relay_2), Wrap=False)  # -> flatten(List)
panel_64 = Panel(insert_items)
panel_65 = Panel(flatten_tree)

addition_7 = Addition(A=subtraction_9, B=2)
line_12 = Line(StartPoint=point_13, EndPoint=point_8)  # -> graft(Line)
relay_3 = Relay([number_3, addition_7])
flatten_tree_2 = FlattenTree(Tree=brep_plane_3.Curves, Path="{0}")
replace_items_2 = ReplaceItems(List=flatten(line_12), Item=flatten(line_4), Indices=flatten(relay_3), Wrap=True)  # -> graft(List)
length_11 = Length(Curve=flatten_tree_2)
panel_66 = Panel(length_11)
length_12 = Length(Curve=line_12)
curve_4 = Curve(brep_plane_3.Curves)
loft = Loft(
    Curves=flatten(line_12),
    Options={Adjust=False, Closed=False, LoftEnds=0, LoftSimp=0, LoftType=0, Rebuild=10, Refit=0.01})
panel_67 = Panel(line_12)
flip_curve_2 = FlipCurve(Curve=replace_items_2)  # -> Curve, Flag
multiplication_19 = Multiplication(A=reverse(panel_64), B=1)  # -> reverse(graft(Result))
negative_10 = Negative(Value=multiplication_19)
bounds_2 = Bounds(Numbers=flatten(negative_10))

division_26 = Division(A=negative_10, B=50)
power_5 = Power(A=10, B=division_26)

remap_numbers_3 = RemapNumbers(Value=negative_10, Source=bounds_2, Target=Domain(0, 1))  # -> Mapped, Clipped
stream_filter_6 = StreamFilter(Gate=1, Stream0=power_5, Stream1=remap_numbers_3.Mapped)
subtraction_11 = Subtraction(A=1, B=stream_filter_6)
multiplication_20 = Multiplication(A=subtraction_11, B=deconstruct_domain_6.End)
subtraction_12 = Subtraction(A=deconstruct_domain_6.End, B=multiplication_20)
construct_domain_5 = ConstructDomain(DomainStart=deconstruct_domain_6.End, DomainEnd=subtraction_12)
panel_68 = Panel(power_5)
panel_69 = Panel(construct_domain_5)
sub_curve = SubCurve(BaseCurve=curve_2, Domain=construct_domain_5)
curve_5 = Curve(sub_curve)
panel_70 = Panel(sub_curve)
panel_72 = Panel(replace_items_2)

end_points_9 = EndPoints(Curve=curve_5)  # -> Start, End
point_14 = Point(end_points_9.Start)

list_length_6 = ListLength(List=flatten(curve_4))
map_to_surface = MapToSurface(Curve=line_12, Source=flatten(loft), Target=flatten(surface))
length_13 = Length(Curve=map_to_surface)
panel_73 = Panel(curve_4)
panel_74 = Panel(length_13)
end_points_10 = EndPoints(Curve=brep_plane_3.Curves)  # -> Start, End
mirror_6 = Mirror(Geometry=join_curves_3, Plane=yz_plane)  # -> Geometry, Transform
subtraction_13 = Subtraction(A=list_length_6, B=1)
mirror_7 = Mirror(Geometry=join_curves_3, Plane=xy_plane)  # -> Geometry, Transform
scale_to_length_2 = ScaleToLength(Curve=flip_curve_2.Curve, Plane=point_13, Length=multiplication_19, FactorX=1, FactorY=1, FactorZ=1)  # -> Scaled, Transform; disabled
end_points_11 = EndPoints(Curve=scale_to_length_2.Scaled)  # -> Start, End
point_15 = Point(end_points_10.End)
point_16 = Point(flatten(point_15))
circle_cnr_5 = CircleCNR(Center=point_16, Normal=point_16, Radius=multiplication_18)  # -> flatten(Circle)
tangent_lines = TangentLines(Point=point_8, Circle=flatten(circle_cnr_5))  # -> flatten(Tangent1), flatten(Tangent2)
mirror_8 = Mirror(Geometry=join_curves_3, Plane=xz_plane_2)  # -> Geometry, Transform
join_curves_5 = JoinCurves(Curves=flatten([join_curves_3, mirror_6.Geometry, mirror_7.Geometry, mirror_8.Geometry]), Preserve=False)  # -> flatten(Curves)
smooth_corners = SmoothCorners(Curve=join_curves_5, Parameter=Slider(2.000001, range=0..100), Continuity=1)  # -> flatten(CompoundCurve)
offset_on_srf_2 = OffsetOnSrf(Curve=tangent_lines.Tangent2, Distance=1e-10, Surface=sphere)  # disabled
offset_on_srf_3 = OffsetOnSrf(Curve=tangent_lines.Tangent1, Distance=1e-10, Surface=sphere)  # disabled
pipe_2 = Pipe(Curve=join_curves_3, Radius=multiplication_16, Caps=2)  # -> flatten(Pipe); disabled
point_17 = Point(end_points_11.End)
curve_6 = Curve(sub_curve)
offset_on_srf_4 = OffsetOnSrf(Curve=smooth_corners, Distance=1e-10, Surface=list_item)  # -> flatten(Curve); disabled

curve_7 = Curve(curve_6)
graft_tree_4 = GraftTree(Tree=curve_7, IncludeEmptyLists=True, IncludeNullItems=True)

end_points_12 = EndPoints(Curve=curve_7)  # -> Start, End
point_18 = Point(flatten(end_points_12.Start))
insert_items_2 = InsertItems(List=curve_7, Item=line_8, Indices=number_4, Wrap=False)  # disabled
line_sdl_6 = LineSDL(Start=point_18, Direction=Vector(0, 0, 1), Length=100000)
circle_tantan = CircleTanTan(CurveA=flatten(tangent_lines.Tangent1), CurveB=flatten(tangent_lines.Tangent2), Point=flatten(point_14))
flatten_tree_3 = FlattenTree(Tree=insert_items_2, Path="{0}")
panel_75 = Panel(circle_cnr_5)
length_14 = Length(Curve=curve_7)  # -> flatten(Length)
polar_array_2 = PolarArray(Geometry=offset_on_srf, Plane=brep_brep.Curves, Count=3, Angle=6.283185307)  # -> flatten(Geometry), Transform
insert_items_3 = InsertItems(List=flatten_tree_3, Item=line_8, Indices=subtraction_13, Wrap=False)  # -> flatten(List)
panel_76 = Panel(circle_tantan)

length_15 = Length(Curve=brep_plane_3.Curves)
sort_list = SortList(Keys=flatten(length_15), ValuesValuesA=flatten(brep_plane_3.Curves))  # -> flatten(Keys), flatten(ValuesValuesA)
reverse_list = ReverseList(List=sort_list.Keys)
reverse_list_2 = ReverseList(List=sort_list.ValuesValuesA)
panel_77 = Panel(reverse_list)

split_with_brep = SplitWithBrep(Curve=smooth_corners, Brep=list_item)  # -> Curve, Points

length_16 = Length(Curve=scale_to_length_2.Scaled)
sort_list_2 = SortList(Keys=flatten(length_16), ValuesValuesA=flatten(scale_to_length_2.Scaled))  # -> flatten(Keys), flatten(ValuesValuesA)
reverse_list_3 = ReverseList(List=sort_list_2.Keys)
reverse_list_4 = ReverseList(List=sort_list_2.ValuesValuesA)
panel_78 = Panel(reverse_list_3)

curve_8 = Curve(line_12)
curve_9 = Curve(split_with_brep.Curve)
curve_10 = Curve(curve_7)
curve_domain_3 = CurveDomain(Curve=graft_tree_4)  # -> Curve, Domain
deconstruct_domain_7 = DeconstructDomain(Domain=curve_domain_3.Domain)  # -> Start, End
panel_79 = Panel(deconstruct_domain_7.End)

mirror_9 = Mirror(Geometry=brep_plane_2.Curves, Plane=_4point_surface)  # -> Geometry, Transform
end_points_13 = EndPoints(Curve=mirror_9.Geometry)  # -> Start, End
point_19 = Point(end_points_13.Start)

curve_11 = Curve(curve_7)
point_20 = Point(flatten(point_19))
curve_12 = Curve(curve_7)
length_17 = Length(Curve=circle_cnr_5)
flatten_tree_4 = FlattenTree(Tree=point_15, Path="{0}")  # -> flatten(Tree)
polyline = PolyLine(Vertices=flatten_tree_4, Closed=False)
division_27 = Division(A=length_17, B=pi)

list_item_22 = ListItem(List=flatten(brep_plane_3.Curves), Index=0, Wrap=True)
evaluate_length_7 = EvaluateLength(Curve=list_item_22, Length=1, Normalized=True)  # -> Point, Tangent, Parameter
list_item_23 = ListItem(List=flatten(division_27), Index=0, Wrap=True)
circle_cnr_6 = CircleCNR(Center=evaluate_length_7.Point, Normal=evaluate_length_7.Tangent, Radius=list_item_23)
tangent_lines_2 = TangentLines(Point=Point(0, 0, 0), Circle=circle_cnr_6)  # -> Tangent1, Tangent2
evaluate_length_8 = EvaluateLength(Curve=tangent_lines_2.Tangent1, Length=1, Normalized=True)  # -> Point, Tangent, Parameter
evaluate_length_9 = EvaluateLength(Curve=tangent_lines_2.Tangent2, Length=1, Normalized=True)  # -> Point, Tangent, Parameter
rotate_9 = Rotate(Geometry=evaluate_length_9.Point, Angle=range_8, Plane=xy_plane)  # -> Geometry, Transform
rotate_10 = Rotate(Geometry=evaluate_length_8.Point, Angle=range_8, Plane=xy_plane)  # -> Geometry, Transform

explode = Explode(Curve=polyline, Recursive=True)  # -> Segments, Vertices
curve_middle_3 = CurveMiddle(Curve=explode.Segments)  # -> flatten(Midpoint)
length_18 = Length(Curve=circle_tantan)
list_item_24 = ListItem(List=panel_78, Index=0, Wrap=True)
length_19 = Length(Curve=explode.Segments)
list_item_25 = ListItem(List=length_12, Index=0, Wrap=True)
line_13 = Line(StartPoint=flatten_tree_4, EndPoint=curve_middle_3)
length_20 = Length(Curve=line_13)
panel_80 = Panel(division_27)
division_28 = Division(A=list_item_25, B=list_item_24)
scale_4 = Scale(Geometry=scale_to_length_2.Scaled, Center=point_17, Factor=division_28)  # -> Geometry, Transform
offset_on_srf_5 = OffsetOnSrf(Curve=scale_4.Geometry, Distance=1e-10, Surface=list_item_8)  # disabled
insert_items_4 = InsertItems(List=flatten(offset_on_srf_5), Item=flatten(line_4), Indices=flatten(relay_2), Wrap=False)
hoopsnake = HoopSnake(
    StartingData=insert_items_4,
    Data=insert_items_4,
    TerminationCondition=Toggle(False),
    Trigger=Button(),
    Hoopsnake_Data_autoUpdate=True,
    Hoopsnake_Data_dataLimit=2147483647,
    Hoopsnake_Data_delay=0,
    Hoopsnake_Data_resetCounter=True,
    Hoopsnake_Data_updateView=True)  # -> Feedback, CumulativeFeedback, LoopsCounter, IterationsCounter
panel_81 = Panel(scale_4.Geometry)
curve_13 = Curve(scale_4.Geometry)
panel_82 = Panel(length_19)
division_29 = Division(A=length_18, B=pi_2)
heterogen_custom = HeterogenCustom(Struts=flatten(insert_items_3), StartRadii=flatten(division_27), EndRadii=flatten(division_29))  # disabled
panel_83 = Panel(length_20)
multipipe = MultiPipe(Curves=relay, NodeSize=multiplication_16, EndOffset=1, StrutSize=1, Segment=0, KinkAngle=0.6, CubeFit=0, Caps=0)  # -> flatten(Pipe); disabled
panel_84 = Panel(division_29)
replace_items_3 = ReplaceItems(List=flatten(line_12), Item=flatten(line_4), Indices=flatten(relay_3), Wrap=True)  # -> graft(List)
data_6 = Data(Tree({1}: ["", "", "⠀⠀⠀⠀ⵙ⠀ᗝ⠀ⵙ⠀✤⠀ⵙ⠀ᙁ⠀ⵙ⠀◯⠀ⵙ⠀Ⓞ⠀ⵙ⠀ᴥ⠀ⵙ⠀ߦ⠀ⵙ⠀◯⠀ⵙ⠀ⵔ⠀ⵙ⠀ⵔ⠀ⵙ⠀ⵘ⠀ⵙ⠀ⵈ⠀ⵙ⠀◯⠀ⵙ⠀옷⠀ⵙ⠀ᴥ⠀ⵙ⠀◯⠀ⵙ⠀ߦ⠀ⵙ⠀Ⓞ⠀ⵙ⠀Ⓞ⠀ⵙ⠀ᙁ⠀ⵙ⠀ᗱᗴ⠀ⵙ⠀ᴥ⠀ⵙ⠀⠀⠀⠀◯⠀⠀⠀⠀ⵙ⠀⠀⠀⠀◯⠀⠀⠀⠀ⵙ⠀ᴥ⠀ⵙ⠀ᗱᗴ⠀ⵙ⠀ᙁ⠀ⵙ⠀Ⓞ⠀ⵙ⠀Ⓞ⠀ⵙ⠀ߦ⠀ⵙ⠀◯⠀ⵙ⠀ᴥ⠀ⵙ⠀옷⠀ⵙ⠀◯⠀ⵙ⠀ⵈ⠀ⵙ⠀ⵘ⠀ⵙ⠀ⵔ⠀ⵙ⠀ⵔ⠀ⵙ⠀◯⠀ⵙ⠀ߦ⠀ⵙ⠀ᴥ⠀ⵙ⠀Ⓞ⠀ⵙ⠀◯⠀ⵙ⠀ᙁ⠀ⵙ⠀✤⠀ⵙ⠀ᗝ⠀ⵙ⠀⠀⠀⠀", "⠀⠀⠀⠀ⵙ⠀ᗱᗴ⠀ⵙ⠀ᗯ⠀ⵙ⠀ᗩ⠀ⵙ⠀✤⠀ⵙ⠀ꖴ⠀ⵙ⠀ᴥ⠀ⵙ⠀✤⠀ⵙ⠀◯⠀ⵙ⠀ᔓᔕ⠀ⵙ⠀ИN⠀ⵙ⠀Ⓞ⠀ⵙ⠀ꖴ⠀ⵙ⠀ᗝ⠀ⵙ⠀ꖴ⠀ⵙ⠀ᗯ⠀ⵙ⠀ꖴ⠀ⵙ⠀ᗝ⠀ⵙ⠀◯⠀ⵙ⠀ᙁ⠀ⵙ⠀ᗩ⠀ⵙ⠀ᑎ⠀ⵙ⠀¤⠀ⵙ⠀ᗱᗴ⠀ⵙ⠀◯⠀ⵙ⠀△⠀ⵙ⠀꞉⠀ⵙ⠀⠀⠀⠀◯⠀⠀⠀⠀ⵙ⠀⠀⠀⠀◯⠀⠀⠀⠀ⵙ⠀꞉⠀ⵙ⠀△⠀ⵙ⠀◯⠀ⵙ⠀ᗱᗴ⠀ⵙ⠀¤⠀ⵙ⠀ᑎ⠀ⵙ⠀ᗩ⠀ⵙ⠀ᙁ⠀ⵙ⠀◯⠀ⵙ⠀ᗝ⠀ⵙ⠀ꖴ⠀ⵙ⠀ᗯ⠀ⵙ⠀ꖴ⠀ⵙ⠀ᗝ⠀ⵙ⠀ꖴ⠀ⵙ⠀Ⓞ⠀ⵙ⠀ИN⠀ⵙ⠀ᔓᔕ⠀ⵙ⠀◯⠀ⵙ⠀✤⠀ⵙ⠀ᴥ⠀ⵙ⠀ꖴ⠀ⵙ⠀✤⠀ⵙ⠀ᗩ⠀ⵙ⠀ᗯ⠀ⵙ⠀ᗱᗴ⠀ⵙ⠀⠀⠀⠀", "ⵙᔓᔕᙁᗱᗴ8ꖴᑐᑕᗱᗴᗝⵙᗱᗴᙏᑎᙁⓄᗯⵙ◯ⵙ◯ⵙᗯⓄᙁᑎᙏᗱᗴⵙᗝᗱᗴᑐᑕꖴ8ᗱᗴᙁᔓᔕⵙ", "0", "0", "0", "0", "0"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], {2}: ["", "", "", "", "ⵙⓄꖴ✤ᗩᴥⵙᗱᗴᙏᑎᙁⓄᗯⵙ◯ⵙ◯ⵙᗯⓄᙁᑎᙏᗱᗴⵙᴥᗩ✤ꖴⓄⵙ", "1", "1", "1", "1", "1"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], {3}: ["", "", "", "", "ⵙᗩᙁᑎᙏᴥⓄꗳⵙᗱᗴᙏᑎᙁⓄᗯⵙ◯ⵙ◯ⵙᗯⓄᙁᑎᙏᗱᗴⵙꗳⓄᴥᙏᑎᙁᗩⵙ", "3^-(0/3^4)"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], {4}: ["", "", "", "", "ⵙⴵ✤ᴥᗱᗴ옷ⵙ人ᑐᑕИNᗱᗴᑎ¤ᗱᗴᴥꗳⵙ◯ⵙ◯ⵙꗳᴥᗱᗴ¤ᑎᗱᗴИNᑐᑕ人ⵙ옷ᗱᗴᴥ✤ⴵⵙ", "56666.2052450414"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], {5}: ["", "", "", "", "ⵙᗩᙁᑎᙏᴥⓄꗳⵙ人ᑐᑕИNᗱᗴᑎ¤ᗱᗴᴥꗳⵙ◯ⵙ◯ⵙꗳᴥᗱᗴ¤ᑎᗱᗴИNᑐᑕ人ⵙꗳⓄᴥᙏᑎᙁᗩⵙ", "1/84.406022589954030768899117092091000289089388918088900852079*(3^(1/3^3))^378"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], {6}: ["", "", "", "", "", "1", "1", "1", "1", "1"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], {7}: ["", "", "", "", "", "1", "", "", "1", ""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], {8}: ["", "", "", "", "", "1", "", "", "", ""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], {9}: ["", "", "", "", "", "1", "", "", "", ""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], {10}: ["", "", "", "", "", "", "", "", "", ""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], {11}: ["", "", "", "", "", "", "", "", "", ""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], {12}: ["", "", "", "", "", "4", "1", "1", "2", "1"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]))
data_7 = Data(Tree({1}: ["", "", "⠀⠀⠀⠀ⵙ⠀ᗝ⠀ⵙ⠀✤⠀ⵙ⠀ᙁ⠀ⵙ⠀◯⠀ⵙ⠀Ⓞ⠀ⵙ⠀ᴥ⠀ⵙ⠀ߦ⠀ⵙ⠀◯⠀ⵙ⠀ⵔ⠀ⵙ⠀ⵔ⠀ⵙ⠀ⵘ⠀ⵙ⠀ⵈ⠀ⵙ⠀◯⠀ⵙ⠀옷⠀ⵙ⠀ᴥ⠀ⵙ⠀◯⠀ⵙ⠀ߦ⠀ⵙ⠀Ⓞ⠀ⵙ⠀Ⓞ⠀ⵙ⠀ᙁ⠀ⵙ⠀ᗱᗴ⠀ⵙ⠀ᴥ⠀ⵙ⠀⠀⠀⠀◯⠀⠀⠀⠀ⵙ⠀⠀⠀⠀◯⠀⠀⠀⠀ⵙ⠀ᴥ⠀ⵙ⠀ᗱᗴ⠀ⵙ⠀ᙁ⠀ⵙ⠀Ⓞ⠀ⵙ⠀Ⓞ⠀ⵙ⠀ߦ⠀ⵙ⠀◯⠀ⵙ⠀ᴥ⠀ⵙ⠀옷⠀ⵙ⠀◯⠀ⵙ⠀ⵈ⠀ⵙ⠀ⵘ⠀ⵙ⠀ⵔ⠀ⵙ⠀ⵔ⠀ⵙ⠀◯⠀ⵙ⠀ߦ⠀ⵙ⠀ᴥ⠀ⵙ⠀Ⓞ⠀ⵙ⠀◯⠀ⵙ⠀ᙁ⠀ⵙ⠀✤⠀ⵙ⠀ᗝ⠀ⵙ⠀⠀⠀⠀", "ⵙᔓᔕᙁᗱᗴ8ꖴᑐᑕᗱᗴᗝⵙ◯ⵙ◯ⵙᗝᗱᗴᑐᑕꖴ8ᗱᗴᙁᔓᔕⵙ", "-0.0009967", "-3.6736", "-0.0009967", "-0.0009967", "-0.0009967", "-5.7216"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], {2}: ["", "", "", "ⵙⴵ✤ᴥᗱᗴ옷ⵙ◯ⵙ◯ⵙ옷ᗱᗴᴥ✤ⴵⵙ", "28160", "26579.5006451166", "25087.707902832", "23679.6430535447", "22350.6068117123", "21096.1636424237"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], {3}: ["", "", "", "ⵙᗱᗴ✤ⓄИNⵙ◯ⵙ◯ⵙИNⓄ✤ᗱᗴⵙ", "A10", "G#9", "G9", "F#9", "F9", "E9"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], {4}: ["", "", "", "ⵙᗱᗴⵙᗯⵙᗩⵙ✤ⵙᑐᑕⵙⓄⵙ⠀⠀⠀⠀◯⠀⠀⠀⠀ⵙ⠀⠀⠀⠀◯⠀⠀⠀⠀ⵙⓄⵙᑐᑕⵙ✤ⵙᗩⵙᗯⵙᗱᗴⵙ", "10", "9", "", "", "", ""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], {5}: ["", "", "", """⠀
⠀
⠀
⠀
⠀
⠀
⠀
⠀
⠀
⠀
⠀
⠀
⠀
⠀
⠀
⠀
◯ 000088880000\MOϽ.DUⓄLϽDИUⓄƧ\\:PTTH ◯⠀ ⠀◯ HTTP://SⓄUNDCLⓄUD.COM/000088880000 ◯
ꖴ
◯ 000088880000\MOϽ.DUⓄLϽDИUⓄƧ\\:PTTH ◯⠀ ⠀◯ HTTP://SⓄUNDCLⓄUD.COM/000088880000 ◯
⊚
◯ UЯ.ƧDЯAⓄBI.Ⓞ\\:PTTH ◯⠀ ⠀◯ HTTP://Ⓞ.IBⓄARDS.RU ◯
ꖴ
◯ UЯ.ƧDЯAⓄBI.Ⓞ\\:PTTH ◯⠀ ⠀◯ HTTP://Ⓞ.IBⓄARDS.RU ◯
ⵙ
◯ UЯ.ƧDЯAⓄBI.Ⓞ\\:PTTH ◯⠀ ⠀◯ HTTP://Ⓞ.IBⓄARDS.RU ◯
ꖴ
◯ UЯ.ƧDЯAⓄBI.Ⓞ\\:PTTH ◯⠀ ⠀◯ HTTP://Ⓞ.IBⓄARDS.RU ◯
⊚
◯ 000088880000\MOϽ.DUⓄLϽDИUⓄƧ\\:PTTH ◯⠀ ⠀◯ HTTP://SⓄUNDCLⓄUD.COM/000088880000 ◯
ꖴ
◯ 000088880000\MOϽ.DUⓄLϽDИUⓄƧ\\:PTTH ◯⠀ ⠀◯ HTTP://SⓄUNDCLⓄUD.COM/000088880000 ◯
⠀
⠀
⠀
⠀
⠀
⠀
⠀
⠀
⠀
⠀
⠀
⠀
⠀
⠀
⠀
⠀""", "", "", "", "", "", ""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]))
digit_scroller_16 = DigitScroller(Scroller_Digits=12, Scroller_Prefix="Index", Scroller_Radix=11, Scroller_Value=22)
digit_scroller_17 = DigitScroller(Scroller_Digits=12, Scroller_Prefix="Scale", Scroller_Radix=11, Scroller_Value=112)
number_slider_21 = Slider(15, range=0..90)
number_slider_22 = Slider(4.3, range=1..50)
number_slider_23 = Slider(4.1, range=0..10)
number_slider_24 = Slider(4.8, range=0..10)
crv = Curve(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)
panel_85 = Panel("1")
infoglasses_2 = InfoGlasses(Run=True, Language=0, assemSet=False, cateSet=False, showName=False)
relay_4 = Relay()
digit_scroller_18 = DigitScroller(Scroller_Digits=12, Scroller_Prefix="Scale", Scroller_Radix=11, Scroller_Value=122)
list_item_26 = ListItem(List=flatten(relay_4), Index=0, Wrap=False)

digit_scroller_19 = DigitScroller(Scroller_Digits=12, Scroller_Prefix="Digit Scroller", Scroller_Radix=11, Scroller_Value=1)
digit_scroller_20 = DigitScroller(Scroller_Digits=12, Scroller_Prefix="Digit Scroller", Scroller_Radix=11, Scroller_Value=116)
curvature_graph_3 = CurvatureGraph(Curve=list_item_26, Density=digit_scroller_19, Scale=digit_scroller_20)

length_21 = Length(Curve=list_item_26)
insert_items_5 = InsertItems(List=flatten(relay_4), Item=flatten(line_4), Indices=flatten(relay_2), Wrap=False)
number_slider_25 = Slider(102, range=0..145)
pipe_3 = Pipe(Curve=curve_12, Radius=division_27, Caps=2)  # disabled
flatten_tree_5 = FlattenTree(Tree=relay_2, Path="{0}")
list_item_27 = ListItem(List=flatten_tree_5, Index=1, Wrap=True)
addition_8 = Addition(A=Slider(7, range=0..146), B=Slider(1, range=0..2))
curve_14 = Curve(flatten(curve_12))
curve_15 = Curve(flatten(insert_items_5))
list_item_28 = ListItem(List=reverse(flatten(curve_15)), Index=flatten(number_slider_25), Wrap=False)  # -> graft(Item)
number_11 = Number(1)
list_length_7 = ListLength(List=curve_15)
subtraction_14 = Subtraction(A=list_length_7, B=1)
addition_9 = Addition(A=number_11, B=list_item_27)
panel_87 = Panel(curve_15)
construct_domain_6 = ConstructDomain(DomainStart=number_11, DomainEnd=list_item_27)
division_30 = Division(A=addition_9, B=2)
number_12 = Number([1, 145])
subtraction_15 = Subtraction(A=list_item_27, B=1)
range_11 = Range(Domain=flatten(construct_domain_6), Steps=flatten(subtraction_15))
list_length_8 = ListLength(List=range_11)
range_12 = Range(Domain=construct_domain_6, Steps=subtraction_15)  # -> simplify(flatten(Range))
list_length_9 = ListLength(List=range_12)
subtraction_16 = Subtraction(A=list_length_9, B=1)
range_13 = Range(Domain=Domain(0, 1), Steps=subtraction_16)  # -> flatten(Range)
graph_mapper = GraphMapper(range_13, x0=0, x1=0.0185, y0=0.9814, y1=1, container_name="Sine", Equation_px=[0, 1], Equation_py=[0, 1])
graft_tree_5 = GraftTree(Tree=graph_mapper, IncludeEmptyLists=True, IncludeNullItems=True)
list_item_29 = ListItem(List=flatten(rotate_6.Geometry), Index=flatten(range_11), Wrap=False)  # -> graft(Item)

point_21 = Point(rotate_10.Geometry)
point_22 = Point(rotate_9.Geometry)
list_item_30 = ListItem(List=flatten(point_22), Index=flatten(range_11), Wrap=False)  # -> graft(Item)
list_item_31 = ListItem(List=flatten(point_21), Index=flatten(range_11), Wrap=False)  # -> graft(Item)

range_14 = Range(Domain=flatten(construct_domain_6), Steps=flatten(subtraction_15))
list_item_32 = ListItem(List=reverse(flatten(division_27)), Index=flatten(range_14), Wrap=False)  # -> graft(Item)
list_item_33 = ListItem(List=flatten(list_item_32), Index=0, Wrap=False)
multiplication_21 = Multiplication(A=list_item_33, B=2)
multiplication_22 = Multiplication(A=multiplication_21, B=multiplication_3)
addition_10 = Addition(A="50000", B=multiplication_22)
division_31 = Division(A=addition_10, B="50000")  # -> graft(Result)
bounds_3 = Bounds(Numbers=flatten(division_31))
deconstruct_domain_8 = DeconstructDomain(Domain=bounds_3)  # -> Start, End
one_over_x_3 = OneOverX(Value=deconstruct_domain_8.End)
multiplication_23 = Multiplication(A=one_over_x_3, B=division_31)
panel_88 = Panel(multiplication_23)

curve_16 = Curve(line_12)
list_item_34 = ListItem(List=flatten(curve_16), Index=flatten(range_11), Wrap=False)  # -> graft(Item)
scale_5 = Scale(Geometry=list_item_34, Center=Point(0, 0, 0), Factor=panel_88)  # -> Geometry, Transform

list_item_35 = ListItem(List=flatten(scale_5.Geometry), Index=digit_scroller_8, Wrap=False)
panel_89 = Panel(division_31)
scale_6 = Scale(Geometry=list_item_30, Center=Point(0, 0, 0), Factor=panel_88)  # -> Geometry, Transform
scale_7 = Scale(Geometry=list_item_31, Center=Point(0, 0, 0), Factor=panel_88)  # -> Geometry, Transform
list_item_36 = ListItem(List=reverse(flatten(division_29)), Index=flatten(range_14), Wrap=False)  # -> graft(Item)
relay_5 = Relay([number_11, division_30, number_slider_25, list_item_27])
list_item_37 = ListItem(List=reverse(flatten(curve_15)), Index=flatten(range_14), Wrap=False)  # -> graft(Item)
evaluate_length_10 = EvaluateLength(Curve=graft(list_item_37), Length=[0, 1], Normalized=True)  # -> Point, Tangent, reverse(Parameter)
panel_90 = Panel(list_item_37)
addition_11 = Addition(A=range_14, B=0)
panel_91 = Panel(list_item_36)
panel_92 = Panel(range_14)
relay_6 = Relay([list_item_32, list_item_36])
pipe_variable_2 = PipeVariable(Curve=list_item_37, Parameters=evaluate_length_10.Parameter, Radii=relay_6, Caps=2)
division_32 = Division(A=relay_6, B=2)
panel_93 = Panel(division_32)
number_slider_26 = Slider(1, range=0..1)
evaluate_length_11 = EvaluateLength(Curve=graft(list_item_37), Length=[0, 1], Normalized=True)  # -> Point, Tangent, reverse(Parameter)
pipe_variable_3 = PipeVariable(Curve=list_item_37, Parameters=evaluate_length_11.Parameter, Radii=relay_6, Caps=2)  # disabled
panel_95 = Panel(list_item_32)
panel_96 = Panel(relay_6)
deconstruct_brep = DeconstructBrep(Brep=pipe_variable_3)  # -> Faces, Edges, Vertices
panel_97 = Panel(deconstruct_brep.Faces)
panel_98 = Panel(deconstruct_brep.Edges)
panel_99 = Panel(deconstruct_brep.Vertices)
graft_tree_6 = GraftTree(Tree=pipe_variable_3, IncludeEmptyLists=True, IncludeNullItems=True)
panel_100 = Panel(pipe_variable_3)
negative_11 = Negative(Value=evaluate_length_11.Parameter)
panel_102 = Panel(evaluate_length_11.Parameter)
loft_options_2 = LoftOptions(Closed=False, Adjust=False, Rebuild=0, Refit=0, Type=Slider(0, range=0..5))
group_2 = Group(Objects=line_sdl_5)
square_root = SquareRoot(Value=2)
B = B(1.5)
B_2 = B(1.5)

end_points_14 = EndPoints(Curve=curve_7)  # -> Start, End

point_23 = Point(end_points_14.End)
line_14 = Line(StartPoint=point_23, EndPoint=Point(0, 0, 0))

digit_scroller_21 = DigitScroller(Scroller_Digits=12, Scroller_Prefix="Digit Scroller", Scroller_Radix=1, Scroller_Value=1.2272527)
curve_17 = Curve([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])
data_8 = Data([0.8079274029, 0.8790455093, 0.9172240822, 0.9468744442, 0.9871896273, 1.013260666, 1.0390204, 1.068164539, 1.10455833, 1.132016405, 1.158958041, 1.183427434, 1.210625133, 1.239123792, 1.267539518, 1.295098862, 1.322851864, 1.35005354, 1.376512608, 1.402818553, 1.428402561, 1.453558327, 1.480114869, 2.149609642, 2.818453989, 3.45913616, 4.068516746, 4.628916793, 3.864089679])
panel_105 = Panel(data_8)

panel_106 = Panel(division_27)

multiplication_24 = Multiplication(A=panel_106, B="(1.22725320000+1.22725270000)/2")

number_slider_27 = Slider(0.02854, range=0..1)

# ---- group: ⠀⠀⠀⠀ⵙ⠀ᗱᗴ⠀ⵙ⠀ߦ⠀ⵙ⠀Ⓞ⠀ⵙ⠀ᑐᑕ⠀ⵙ⠀ᔓᔕ⠀ⵙ⠀⠀⠀⠀◯⠀⠀⠀⠀ⵙ⠀⠀⠀⠀◯⠀⠀⠀⠀ⵙ⠀ᔓᔕ⠀ⵙ⠀ᑐᑕ⠀ⵙ⠀Ⓞ⠀ⵙ⠀ߦ⠀ⵙ⠀ᗱᗴ⠀ⵙ⠀⠀⠀⠀
digit_scroller_22 = DigitScroller(Scroller_Digits=12, Scroller_Prefix="Digit Scroller", Scroller_Radix=11, Scroller_Value=27)
list_item_38 = ListItem(List=flatten(scale_5.Geometry), Index=flatten(digit_scroller_22), Wrap=False)
list_item_39 = ListItem(List=flatten(scale_5.Transform), Index=flatten(digit_scroller_22), Wrap=False)
length_22 = Length(Curve=list_item_38)
panel_107 = Panel(list_item_39)
deconstruct_matrix_2 = DeconstructMatrix(Matrix=list_item_39)  # -> Rows, Columns, Values
panel_108 = Panel(length_22)
panel_109 = Panel(deconstruct_matrix_2.Values)

# ----
range_15 = Range(Domain=flatten(Domain(0, 1)), Steps=flatten(subtraction_15))
expression_3 = Expression(
    O=range_15,
    OO=digit_scroller_6,
    OOO=digit_scroller_7,
    Expression="1-(-COS(4*ATAN(1)*O*2*((((OO)))))/2+.5)*((((1/OOO))))")

expression_4 = Expression(
    O=range_15,
    OO=digit_scroller_6,
    OOO=digit_scroller_7,
    Expression="(1-(-ASIN(COS(4*ATAN(1)*O*2*((((OO))))))/(4*ATAN(1))+.5)*((((1/OOO)))))")
list_length_10 = ListLength(List=range_15)
subtraction_17 = Subtraction(A=list_length_10, B=1)
division_33 = Division(A=subtraction_17, B=14)
division_34 = Division(A=digit_scroller_5, B=division_33)
stream_filter_7 = StreamFilter(Gate=Slider(0, range=0..1), Stream0=expression_4, Stream1=expression_3)

construct_point_3 = ConstructPoint(XCoordinate=range_15, YCoordinate=stream_filter_7, ZCoordinate=0)
scale_8 = Scale(Geometry=construct_point_3, Center=Point(0, 0, 0), Factor=Slider(50000, range=0..50000))  # -> Geometry, Transform
graft_tree_7 = GraftTree(Tree=stream_filter_7, IncludeEmptyLists=True, IncludeNullItems=True)

curve_18 = Curve(graft(graft_tree_4))

list_item_40 = ListItem(List=flatten(curve_18), Index=flatten(range_11), Wrap=False)  # -> graft(Item)
scale_9 = Scale(Geometry=list_item_40, Center=Point(0, 0, 0), Factor=panel_88)  # -> Geometry, Transform

# ---- group: ⠀⠀⠀⠀ⵙ⠀ᗱᗴ⠀ⵙ⠀ߦ⠀ⵙ⠀Ⓞ⠀ⵙ⠀ᑐᑕ⠀ⵙ⠀ᔓᔕ⠀ⵙ⠀⠀⠀⠀◯⠀⠀⠀⠀ⵙ⠀⠀⠀⠀◯⠀⠀⠀⠀ⵙ⠀ᔓᔕ⠀ⵙ⠀ᑐᑕ⠀ⵙ⠀Ⓞ⠀ⵙ⠀ߦ⠀ⵙ⠀ᗱᗴ⠀ⵙ⠀⠀⠀⠀ (continued)
list_item_41 = ListItem(List=flatten(scale_9.Transform), Index=flatten(digit_scroller_22), Wrap=False)
deconstruct_matrix_3 = DeconstructMatrix(Matrix=list_item_41)  # -> Rows, Columns, Values
panel_110 = Panel(deconstruct_matrix_3.Values)

# ----
list_item_42 = ListItem(List=flatten(scale_9.Geometry), Index=flatten(Slider(33, range=0..100)), Wrap=False)  # -> graft(Item)
list_item_43 = ListItem(List=flatten(scale_9.Geometry), Index=digit_scroller_8, Wrap=False)
panel_111 = Panel(scale_9.Geometry)
list_item_44 = ListItem(List=flatten(scale_9.Geometry), Index=0, Wrap=False)
pipe_4 = Pipe(Curve=list_item_44, Radius=list_item_33, Caps=2)
deconstruct_brep_2 = DeconstructBrep(Brep=pipe_4)  # -> Faces, Edges, Vertices
solid_intersection = SolidIntersection(BrepsA=pipe_4, BrepsB=sphere)
solid_difference = SolidDifference(BrepsA=pipe_4, BrepsB=sphere)
deconstruct_brep_3 = DeconstructBrep(Brep=solid_difference)  # -> Faces, Edges, Vertices
trim_solid = TrimSolid(Shape=pipe_4, Cutters=sphere)
split_brep = SplitBrep(Brep=pipe_4, Cutter=sphere)
offset_surface = OffsetSurface(Surface=pipe_4, Distance=0, Retrim=True)
scale_10 = Scale(Geometry=list_item_44, Center=Point(0, 0, 0), Factor=division_31)  # -> Geometry, Transform
clean_tree_4 = CleanTree(RemoveNulls=False, RemoveInvalid=True, RemoveEmpty=False, Tree=trim_solid)
brep_brep_4 = BrepBrep(BrepA=pipe_4, BrepB=sphere)  # -> Curves, Points
surface_split_4 = SurfaceSplit(Surface=sphere, Curves=brep_brep_4.Curves)

list_item_45 = ListItem(List=flatten(surface_split_4), Index=Slider(1, range=0..16), Wrap=False)

loft_2 = Loft(
    Curves=[list_item_44, scale_10.Geometry],
    Options={Adjust=False, Closed=False, LoftEnds=0, LoftSimp=0, LoftType=0, Rebuild=10, Refit=0.01})
pipe_5 = Pipe(Curve=list_item_44, Radius=list_item_33, Caps=2)
surface_split_5 = SurfaceSplit(Surface=deconstruct_brep_2.Faces, Curves=brep_brep_4.Curves)
flip_curve_3 = FlipCurve(Curve=scale_9.Geometry)  # -> Curve, Flag
length_23 = Length(Curve=flip_curve_3.Curve)
division_35 = Division(A=length_23, B=3.141592654)
division_36 = Division(A=division_35, B=2)
curve_19 = Curve(flip_curve_3.Curve)
evaluate_length_12 = EvaluateLength(Curve=curve_19, Length=0, Normalized=True)  # -> Point, Tangent, Parameter
line_15 = Line(StartPoint=Point(0, 0, 0), EndPoint=evaluate_length_12.Point)
length_24 = Length(Curve=line_15)
insert_items_6 = InsertItems(List=flatten(scale_9.Geometry), Item=flatten(line_4), Indices=flatten(relay_2), Wrap=False)

insert_items_7 = InsertItems(Item=flatten(line_4), Indices=flatten(relay_2), Wrap=False)

curve_20 = Curve(simplify(curve_6))
list_item_46 = ListItem(List=flatten(curve_20), Index=range_11, Wrap=False)  # -> graft(Item)

scale_11 = Scale(Geometry=curve_20, Center=Point(0, 0, 0), Factor=panel_88)  # -> Geometry, Transform

panel_112 = Panel(scale_11.Geometry)

panel_113 = Panel(list_item_32)
series_6 = Series(Start=0, Step=0, Count=list_length_8)  # -> graft(Series)
radians_3 = Radians(Degrees=Slider(247, range=0..360))
number_slider_28 = Slider(16, range=4..256)

flatten_tree_6 = FlattenTree(Tree=panel_113, Path="{0}")
division_37 = Division(A=division_36, B=panel_113)

spiral_rail_4 = SpiralRail(
    Curve=flip_curve_3.Curve,
    Angle=0.7853981634,
    Turns=division_37,
    BaseRadius=panel_113,
    PeakRadius=series_6,
    SamplePoint=number_slider_28)
c_script_3 = CSharpScript(railCurve=flip_curve_3.Curve, radiusPoint=scale_7.Geometry, turnCount=division_37, radius0=panel_113, radius1=series_6)  # -> out, A; inputs railCurve: Curve, t0: Double, t1: Double, radiusPoint: Point3d, pitch: Double, turnCount: Double, radius0: Double, radius1: Double; same code as c_script

insert_items_8 = InsertItems(List=flatten(c_script_3.A), Item=flatten(line_4), Indices=flatten(relay_2), Wrap=False)  # -> graft(List)

flip_curve_4 = FlipCurve(Curve=insert_items_8)  # -> Curve, Flag

mirror_10 = Mirror(Geometry=flip_curve_4.Curve, Plane=plane_surface_3)  # -> Geometry, Transform
graft_tree_8 = GraftTree(Tree=mirror_10.Geometry, IncludeEmptyLists=True, IncludeNullItems=True)

end_points_15 = EndPoints(Curve=flip_curve_4.Curve)  # -> Start, End
end_points_16 = EndPoints(Curve=mirror_10.Geometry)  # -> Start, End
point_24 = Point(end_points_15.End)
point_25 = Point(end_points_16.End)

line_16 = Line(StartPoint=point_24, EndPoint=point_25)
curve_middle_4 = CurveMiddle(Curve=line_16)
line_17 = Line(StartPoint=Point(0, 0, 0), EndPoint=curve_middle_4)
extend_curve_2 = ExtendCurve(Curve=flatten(line_17), Type=0, Start=0, End=flatten(multiplication_24))
evaluate_length_13 = EvaluateLength(Curve=extend_curve_2, Length=1, Normalized=True)  # -> Point, Tangent, Parameter
blend_curve_pt = BlendCurvePt(
    CurveA=flatten(mirror_10.Geometry),
    CurveB=flatten(insert_items_8),
    Point=flatten(evaluate_length_13.Point),
    Continuity=2)

evaluate_length_14 = EvaluateLength(Curve=blend_curve_pt, Length=0.5, Normalized=True)  # -> Point, Tangent, Parameter
line_18 = Line(StartPoint=point_9, EndPoint=evaluate_length_14.Point)
angle_2 = Angle(VectorA=line_18, VectorB=curve_17)  # -> Angle, Reflex
panel_115 = Panel(angle_2.Angle)
length_25 = Length(Curve=line_18)
panel_116 = Panel(length_25)

blend_curve = BlendCurve(CurveA=mirror_10.Geometry, CurveB=insert_items_8, BulgeA=number_slider_27, BulgeB=number_slider_27, Continuity=1)

panel_117 = Panel(panel_113)
extend_curve_3 = ExtendCurve(Curve=line_15, Type=0, Start=0, End=panel_117)
circle_cnr_7 = CircleCNR(Center=evaluate_length_12.Point, Normal=evaluate_length_12.Tangent, Radius=panel_117)
end_points_17 = EndPoints(Curve=extend_curve_3)  # -> Start, End
pt = Point(end_points_17.End)
circle_cnr_8 = CircleCNR(Center=Point(0, 0, 0), Normal=circle_cnr_7, Radius=length_24)
eval = EvaluateLength(Curve=circle_cnr_7, Length=Slider(0.93, range=0..1), Normalized="true")  # -> Point, Tangent, Parameter
eval_2 = EvaluateLength(Curve=circle_cnr_7, Length=Slider(0.960937, range=0..1), Normalized="true")  # -> Point, Tangent, Parameter
brep_curve = BrepCurve(Brep=list_item_29, Curve=circle_cnr_7)  # -> Curves, Points
null_item_2 = NullItem(Item=brep_curve.Points)  # -> NullFlags, InvalidFlags, flatten(Description)
panel_118 = Panel(null_item_2.Description)
curvature_graph_4 = CurvatureGraph(Curve=c_script_3.A, Density=2, Scale=digit_scroller_18)
multiplication_25 = Multiplication(A=Slider(81, range=0..1000), B=number_slider_28)

divide_curve_5 = DivideCurve(Curve=list_item_26, Count=multiplication_25, Kinks=False)  # -> Points, Tangents, Parameters
curvature_2 = Curvature(Curve=list_item_26, Parameter=divide_curve_5.Parameters)  # -> Point, Curvature, Curvature_2
deconstruct_arc_2 = DeconstructArc(Arc=curvature_2.Curvature_2)  # -> BasePlane, Radius, Angle
line_19 = Line(StartPoint=divide_curve_5.Points, EndPoint=deconstruct_arc_2.BasePlane)  # -> graft(Line)
scale_12 = Scale(Geometry=line_19, Center=graft(divide_curve_5.Points), Factor=-1)  # -> Geometry, Transform
end_points_18 = EndPoints(Curve=scale_12.Geometry)  # -> Start, End
point_26 = Point(end_points_18.End)
interpolate_2 = Interpolate(Vertices=flatten(point_26), Degree=Slider(11, range=1..11), Periodic=False, KnotStyle=0)  # -> Curve, Length, Domain

divide_curve_6 = DivideCurve(Curve=interpolate_2.Curve, Count=multiplication_25, Kinks=False)  # -> Points, Tangents, Parameters
curvature_3 = Curvature(Curve=interpolate_2.Curve, Parameter=divide_curve_6.Parameters)  # -> Point, Curvature, Curvature_2
deconstruct_arc_3 = DeconstructArc(Arc=curvature_3.Curvature_2)  # -> BasePlane, Radius, Angle
line_20 = Line(StartPoint=divide_curve_6.Points, EndPoint=deconstruct_arc_3.BasePlane)  # -> graft(Line)
scale_13 = Scale(Geometry=line_20, Center=graft(divide_curve_6.Points), Factor=-1)  # -> Geometry, Transform
end_points_19 = EndPoints(Curve=scale_13.Geometry)  # -> Start, End
point_27 = Point(end_points_19.End)
interpolate_3 = Interpolate(Vertices=flatten(point_27), Degree=Slider(11, range=1..11), Periodic=False, KnotStyle=0)  # -> Curve, Length, Domain

divide_curve_7 = DivideCurve(Curve=interpolate_3.Curve, Count=multiplication_25, Kinks=False)  # -> Points, Tangents, Parameters
curvature_4 = Curvature(Curve=interpolate_3.Curve, Parameter=divide_curve_7.Parameters)  # -> Point, Curvature, Curvature_2
deconstruct_arc_4 = DeconstructArc(Arc=curvature_4.Curvature_2)  # -> BasePlane, Radius, Angle
line_21 = Line(StartPoint=divide_curve_7.Points, EndPoint=deconstruct_arc_4.BasePlane)  # -> graft(Line)
scale_14 = Scale(Geometry=line_21, Center=graft(divide_curve_7.Points), Factor=-1)  # -> Geometry, Transform
end_points_20 = EndPoints(Curve=scale_14.Geometry)  # -> Start, End
point_28 = Point(end_points_20.End)
interpolate_4 = Interpolate(Vertices=flatten(point_28), Degree=Slider(11, range=1..11), Periodic=False, KnotStyle=0)  # -> Curve, Length, Domain

digit_scroller_23 = DigitScroller(Scroller_Digits=12, Scroller_Prefix="Digit Scroller", Scroller_Radix=11, Scroller_Value=16)
digit_scroller_24 = DigitScroller(Scroller_Digits=12, Scroller_Prefix="Digit Scroller", Scroller_Radix=11, Scroller_Value=120)
curvature_graph_5 = CurvatureGraph(Curve=interpolate_2.Curve, Density=digit_scroller_23, Scale=digit_scroller_24)

digit_scroller_25 = DigitScroller(Scroller_Digits=12, Scroller_Prefix="Digit Scroller", Scroller_Radix=11, Scroller_Value=16)
digit_scroller_26 = DigitScroller(Scroller_Digits=12, Scroller_Prefix="Digit Scroller", Scroller_Radix=11, Scroller_Value=120)
curvature_graph_6 = CurvatureGraph(Curve=interpolate_3.Curve, Density=digit_scroller_25, Scale=digit_scroller_26)

digit_scroller_27 = DigitScroller(Scroller_Digits=12, Scroller_Prefix="Digit Scroller", Scroller_Radix=11, Scroller_Value=16)
digit_scroller_28 = DigitScroller(Scroller_Digits=12, Scroller_Prefix="Digit Scroller", Scroller_Radix=11, Scroller_Value=120)
curvature_graph_7 = CurvatureGraph(Curve=interpolate_4.Curve, Density=digit_scroller_27, Scale=digit_scroller_28)

loft_3 = Loft(Curves=interpolate_2.Curve, Options=loft_options_2)  # disabled

evaluate_length_15 = EvaluateLength(Curve=flip_curve_4.Curve, Length=1, Normalized=True)  # -> Point, Tangent, Parameter
line_sdl_7 = LineSDL(Start=evaluate_length_15.Point, Direction=evaluate_length_15.Tangent, Length=Slider(75, range=0..256))
end_points_21 = EndPoints(Curve=line_sdl_7)  # -> Start, End

mirror_11 = Mirror(Geometry=line_sdl_7, Plane=plane_surface_3)  # -> Geometry, Transform

vector_2pt = Vector2Pt(PointA=end_points_21.Start, PointB=end_points_21.End, Unitize=False)  # -> Vector, Length

end_points_22 = EndPoints(Curve=mirror_11.Geometry)  # -> Start, End
vector_2pt_2 = Vector2Pt(PointA=end_points_22.Start, PointB=end_points_22.End, Unitize=False)  # -> Vector, Length
biarc = BiArc(StartPoint=point_24, StartTangent=vector_2pt.Vector, EndPoint=point_25, EndTangent=vector_2pt_2.Vector, Ratio=0.5)  # -> FirstArc, SecondArc, BiArc

stream_filter_8 = StreamFilter(Gate=Slider(1, range=0..2), Stream0=biarc.BiArc, Stream1=blend_curve_pt, Stream2=blend_curve)

offset_on_srf_6 = OffsetOnSrf(Curve=stream_filter_8, Distance=1e-10, Surface=sphere)  # disabled
insert_items_9 = InsertItems(List=flatten(stream_filter_8), Item=flatten(line_4), Indices=flatten(relay_2), Wrap=False)
hoopsnake_2 = HoopSnake(
    StartingData=insert_items_9,
    Data=insert_items_9,
    Hoopsnake_Data_autoUpdate=False,
    Hoopsnake_Data_dataLimit=2147483647,
    Hoopsnake_Data_delay=0,
    Hoopsnake_Data_resetCounter=True,
    Hoopsnake_Data_updateView=True)  # -> Feedback, CumulativeFeedback, LoopsCounter, IterationsCounter

curve_21 = Curve(stream_filter_8)

list_item_47 = ListItem(List=flatten(curve_21), Index=digit_scroller_2, Wrap=False)
bounding_box_4 = BoundingBox(Content=list_item_47, Plane=PlaneXY(0, 0, 0))  # -> Box, Box_2
deconstruct_box_3 = DeconstructBox(Box=bounding_box_4.Box)  # -> Plane, X, Y, Z
panel_119 = Panel(curve_21)
deconstruct_domain_9 = DeconstructDomain(Domain=deconstruct_box_3.X)  # -> Start, End
subtraction_18 = Subtraction(A=deconstruct_domain_9.End, B=deconstruct_domain_9.Start)
panel_120 = Panel(subtraction_18)
panel_121 = Panel(offset_on_srf_6)
list_item_48 = ListItem(List=flatten(curve_21), Index=Slider(144, range=0..146), Wrap=True)
curvature_graph_8 = CurvatureGraph(Curve=list_item_48, Density=digit_scroller_4, Scale=digit_scroller_3)

curve_22 = Curve(graft(mirror_10.Geometry))
curve_23 = Curve(graft(curve_21))

curve_24 = Curve([curve_18, curve_23, curve_22])

join_curves_6 = JoinCurves(Curves=curve_24, Preserve=False)

list_item_49 = ListItem(List=flatten(curve_23), Index=flatten(range_11), Wrap=False)  # -> graft(Item)
list_item_50 = ListItem(List=flatten(curve_22), Index=flatten(range_11), Wrap=False)  # -> graft(Item)
curve_25 = Curve([c_script_3.A, list_item_49, list_item_50])
join_curves_7 = JoinCurves(Curves=flatten(curve_25), Preserve=False)
list_item_51 = ListItem(List=join_curves_7, Index=digit_scroller_16, Wrap=True)

polar_array_3 = PolarArray(Geometry=flatten(curve_25), Plane=brep_brep.Curves, Count=3, Angle=6.283185307)  # -> flatten(Geometry), Transform
xz_plane_3 = XZPlane(Origin=Point(0, 0, 0))
mirror_12 = Mirror(Geometry=polar_array_3.Geometry, Plane=PlaneYZ(0, 0, 0))  # -> Geometry, Transform
mirror_13 = Mirror(Geometry=[polar_array_3.Geometry, mirror_12.Geometry], Plane=xz_plane_3)  # -> Geometry, Transform
xy_plane_2 = XYPlane(Origin=Point(0, 0, 0))
mirror_14 = Mirror(Geometry=[polar_array_3.Geometry, mirror_12.Geometry, mirror_13.Geometry], Plane=xy_plane_2)  # -> Geometry, Transform

curvature_graph_9 = CurvatureGraph(Curve=list_item_51, Density=Slider(16, range=0..16), Scale=digit_scroller_17)
insert_items_10 = InsertItems(List=flatten(list_item_50), Item=flatten(line_4), Indices=flatten(relay_2), Wrap=False)
insert_items_11 = InsertItems(List=flatten(list_item_49), Item=flatten(line_4), Indices=flatten(relay_2), Wrap=False)
panel_122 = Panel(insert_items_10)
curve_26 = Curve(flatten(curve_21))
list_item_52 = ListItem(List=reverse(flatten(curve_26)), Index=flatten(range_14), Wrap=False)  # -> graft(Item)
pipe_6 = Pipe(Curve=list_item_52, Radius=list_item_32, Caps=0)  # disabled
graft_tree_9 = GraftTree(Tree=pipe_6, IncludeEmptyLists=True, IncludeNullItems=True)
split_brep_2 = SplitBrep(Brep=graft_tree_6, Cutter=graft_tree_9)
list_item_53 = ListItem(List=split_brep_2, Index=0, Wrap=True)
mirror_15 = Mirror(Geometry=list_item_53, Plane=plane_surface_3)  # -> Geometry, Transform
brep_join = BrepJoin(Breps=flatten([list_item_53, graft_tree_9, mirror_15.Geometry]))  # -> flatten(Breps), Closed; disabled
polar_array_4 = PolarArray(Geometry=flatten(brep_join.Breps), Plane=brep_brep.Curves, Count=3, Angle=6.283185307)  # -> flatten(Geometry), Transform; disabled
list_item_54 = ListItem(List=reverse(brep_join.Breps), Index=Slider(4, range=0..5), Wrap=False)
brep_join_2 = BrepJoin(Breps=flatten(polar_array_4.Geometry))  # -> flatten(Breps), Closed
bounding_box_5 = BoundingBox(Content=brep_join_2.Breps, Plane=PlaneXY(0, 0, 0), UnionBox=True)  # -> Box, Box_2
deconstruct_box_4 = DeconstructBox(Box=bounding_box_5.Box)  # -> Plane, X, Y, Z
export_3dm = Export3DM(
    Geometry=brep_join.Breps,
    FileLocation="C:\MDԐ.XHG..⠀⠀⠀⠀ⵙ⠀ᗱᗴ⠀ⵙ⠀ᴥ⠀ⵙ⠀ᗱᗴ⠀ⵙ⠀옷⠀ⵙ⠀ߦ⠀ⵙ⠀ᔓᔕ⠀ⵙ⠀◯⠀ⵙ⠀✤⠀ⵙ⠀ᴥ⠀ⵙ⠀ᗩ⠀ⵙ⠀옷⠀ⵙ⠀ᑐᑕ⠀ⵙ⠀◯⠀ⵙ⠀⁂⠀ⵙ⠀△⠀ⵙ⠀ⵈ⠀ⵙ⠀⠀⠀⠀◯⠀⠀⠀⠀ⵙ⠀⠀⠀⠀◯⠀⠀⠀⠀ⵙ⠀ⵈ⠀ⵙ⠀△⠀ⵙ⠀⁂⠀ⵙ⠀◯⠀ⵙ⠀ᑐᑕ⠀ⵙ⠀옷⠀ⵙ⠀ᗩ⠀ⵙ⠀ᴥ⠀ⵙ⠀✤⠀ⵙ⠀◯⠀ⵙ⠀ᔓᔕ⠀ⵙ⠀ߦ⠀ⵙ⠀옷⠀ⵙ⠀ᗱᗴ⠀ⵙ⠀ᴥ⠀ⵙ⠀ᗱᗴ⠀ⵙ⠀⠀⠀⠀..GHX.3DM",
    Overwrite=Toggle(False),
    Version=0,
    Export=Toggle(False),
    LastSaveLocalization="neutral,N")  # -> OK, Log
panel_123 = Panel(brep_join.Breps)
panel_124 = Panel(polar_array_4.Geometry)
export_3dm_2 = Export3DM(
    Geometry=brep_join_2.Breps,
    FileLocation="C:\MDԐ.Ԑ.XHG..⠀⠀⠀⠀ⵙ⠀ᗱᗴ⠀ⵙ⠀ᴥ⠀ⵙ⠀ᗱᗴ⠀ⵙ⠀옷⠀ⵙ⠀ߦ⠀ⵙ⠀ᔓᔕ⠀ⵙ⠀◯⠀ⵙ⠀✤⠀ⵙ⠀ᴥ⠀ⵙ⠀ᗩ⠀ⵙ⠀옷⠀ⵙ⠀ᑐᑕ⠀ⵙ⠀◯⠀ⵙ⠀⁂⠀ⵙ⠀△⠀ⵙ⠀ⵈ⠀ⵙ⠀⠀⠀⠀◯⠀⠀⠀⠀ⵙ⠀⠀⠀⠀◯⠀⠀⠀⠀ⵙ⠀ⵈ⠀ⵙ⠀△⠀ⵙ⠀⁂⠀ⵙ⠀◯⠀ⵙ⠀ᑐᑕ⠀ⵙ⠀옷⠀ⵙ⠀ᗩ⠀ⵙ⠀ᴥ⠀ⵙ⠀✤⠀ⵙ⠀◯⠀ⵙ⠀ᔓᔕ⠀ⵙ⠀ߦ⠀ⵙ⠀옷⠀ⵙ⠀ᗱᗴ⠀ⵙ⠀ᴥ⠀ⵙ⠀ᗱᗴ⠀ⵙ⠀⠀⠀⠀..GHX.3.3DM",
    Overwrite=Toggle(False),
    Version=0,
    Export=Toggle(False),
    LastSaveLocalization="neutral,N")  # -> OK, Log

number_slider_29 = Slider(10, range=0..10)
construct_point_4 = ConstructPoint(XCoordinate=0, YCoordinate=0, ZCoordinate=0)
division_38 = Division(A=number_slider_29, B="3")
import_obj = ImportOBJ(File="C:\JBO.PIH.FXD.FXD.DXF.DXF.HIP.OBJ", MapYtoZ=False, LastSaveLocalization="neutral,N")
cone_2 = Cone(Base=PlaneYZ(0, 0, 0), Radius=20, Length=80)  # -> Cone, Tip
ⵙ人ⵙᴥⵙ_ⵙᗱᗴⵙᙏⵙ_ⵙᗱᗴⵙᕤᕦⵙ_ⵙ_ⵙᕤᕦⵙᗱᗴⵙ_ⵙᙏⵙᗱᗴⵙ_ⵙᴥ = Slider(1, range=0..1)  # "ⵙ人ⵙᴥⵙ✤ⵙᗱᗴⵙᙏⵙⓄⵙᗱᗴⵙᕤᕦⵙ◯ⵙ◯ⵙᕤᕦⵙᗱᗴⵙⓄⵙᙏⵙᗱᗴⵙ✤ⵙᴥⵙ人ⵙ"
ⵙꕤⵙ_ⵙᴥⵙ_ⵙᴥⵙꖴⵙᙏⵙ_ⵙ_ⵙᙏⵙꖴⵙᴥⵙ_ⵙᴥⵙ_ⵙꕤⵙ = Slider(1, range=0..1)
ⵙꕤⵙ_ⵙ8ⵙ_ⵙᕤᕦⵙиnⵙꖴⵙᗝⵙиnⵙᑎⵙ_ⵙ8ⵙ_ⵙ_ⵙ8ⵙ_ⵙᑎⵙиn = Slider(0, range=0..1)  # "ⵙꕤⵙⓄⵙ8ⵙ◯ⵙᕤᕦⵙИNⵙꖴⵙᗝⵙИNⵙᑎⵙⓄⵙ8ⵙ◯ⵙ◯ⵙ8ⵙⓄⵙᑎⵙИNⵙᗝⵙꖴⵙИNⵙᕤᕦⵙ◯ⵙ8ⵙⓄⵙꕤ"
weldmesh = WeldMesh(Mesh=import_obj, Radius=1e-10, Align=False, Use_RTree=False)
division_39 = Division(A=number_slider_29, B="9")
multiplication_26 = Multiplication(A=number_slider_29, B="sqrt(3)")
spiral = Spiral(
    BasePlane=Plane(origin=(0, 0, 0), x=(0, 1, 0), y=(-1, 0, 0)),
    Angle=31.41592654,
    Turns=division_39,
    BaseRadius=multiplication_26,
    PeakRadius=division_38)
pipe_7 = Pipe(Curve=spiral, Radius=number_slider_29, Caps=2)
multipipe_2 = MultiPipe(
    Curves=spiral,
    NodeSize=division_39,
    EndOffset=division_38,
    StrutSize=division_39,
    Segment=0,
    KinkAngle=0.6,
    CubeFit=0,
    Caps=1)
stream_filter_9 = StreamFilter(Gate=Slider(1, range=0..2), Stream0=import_obj, Stream1=group_2, Stream2=multipipe_2)
geometry = Geometry(stream_filter_9)
bounding_box_6 = BoundingBox(Content=geometry, Plane=PlaneXY(0, 0, 0), UnionBox=True)  # -> Box, Box_2
center_geometry_at_origin = CenterGeometryAtOrigin(Geometry=bounding_box_6.Box)  # -> RecenteredGeometry, TranslationVector
stream_filter_10 = StreamFilter(Gate=ⵙꕤⵙ_ⵙ8ⵙ_ⵙᕤᕦⵙиnⵙꖴⵙᗝⵙиnⵙᑎⵙ_ⵙ8ⵙ_ⵙ_ⵙ8ⵙ_ⵙᑎⵙиn, Stream1=bounding_box_6.Box)
stream_filter_11 = StreamFilter(Gate=ⵙ人ⵙᴥⵙ_ⵙᗱᗴⵙᙏⵙ_ⵙᗱᗴⵙᕤᕦⵙ_ⵙ_ⵙᕤᕦⵙᗱᗴⵙ_ⵙᙏⵙᗱᗴⵙ_ⵙᴥ, Stream1=geometry)
move_2 = Move(Geometry=[stream_filter_11, stream_filter_10], Motion=center_geometry_at_origin.TranslationVector)  # -> Geometry, Transform
export_file_to_path = ExportFileToPath(Run=Toggle(False), GeometryToExport=move_2.Geometry, ExportPath="C:\T888......OBJ")
bounding_box_7 = BoundingBox(Content=move_2.Geometry, Plane=PlaneXY(0, 0, 0), UnionBox=True)  # -> Box, Box_2
geometry_2 = Geometry(move_2.Geometry)
deconstruct_box_5 = DeconstructBox(Box=bounding_box_7.Box)  # -> Plane, X, Y, Z
deconstruct_domain_10 = DeconstructDomain(Domain=deconstruct_box_5.Y)  # -> Start, End
deconstruct_domain_11 = DeconstructDomain(Domain=deconstruct_box_5.Z)  # -> Start, End
deconstruct_domain_12 = DeconstructDomain(Domain=deconstruct_box_5.X)  # -> Start, End
line_22 = Line(Line((-299.7957001, 0, 0), (-299.7957001, -99.65670013, 0)))
line_23 = Line(Line((-99.65670013, 0, 0), (-99.65670013, -0.001, 0)))
geometry_3 = Geometry(<mesh referenced from the Rhino model>)
reduce_mesh = ReduceMesh(Mesh=geometry_3, FaceCount=0, Accuracy=10, FaceType=1, Distort=False, Normalize=False)  # -> Reduced, CountDifference
move_3 = Move(Geometry=reduce_mesh.Reduced, Motion=Vector(-457.5, 0, 238.875))  # -> Geometry, Transform
taper = Taper(
    Geometry=reduce_mesh.Reduced,
    Axis=Line((-299.7957001, 0, 0), (-99.65670013, 0, 0)),
    Start=line_22,
    End=line_23,
    Flat=False,
    Infinite=False,
    Rigid=False)
move_4 = Move(Geometry=taper, Motion=Vector(-199.3134003, 0, 0))  # -> Geometry, Transform
scale_nu_2 = ScaleNU(Geometry=taper, Plane=PlaneXY(-1670.120177, 0, 0), ScaleX=0.7071067812, ScaleY=1, ScaleZ=1)  # -> Geometry, Transform

mesh_join_3 = MeshJoin(Meshes=import_obj)
yz_plane_4 = YZPlane(Origin=Point(0, 0, 0))
mirror_cut_mesh = MirrorCutMesh(
    Mesh=mesh_join_3,
    MirrorPlane=yz_plane_4,
    Reach=0,
    Offset=0,
    Flip=False,
    Join=False,
    Keep=False,
    ConnectionType=2,
    Bulge=0,
    Divisions=0,
    WeldVertices=0)  # -> MirrorCut, SplitIndex, ReachPlane, OffsetPlane, Intersected
mirror_16 = Mirror(Geometry=mirror_cut_mesh.MirrorCut, Plane=PlaneYZ(0, 0, 0))  # -> Geometry, Transform
mesh_join_4 = MeshJoin(Meshes=[mirror_16.Geometry, mirror_cut_mesh.MirrorCut])

division_40 = Division(A=division_20, B=deconstruct_domain_12.End)
addition_12 = Addition(A=division_40, B=1)
division_41 = Division(A=division_40, B=1)
addition_13 = Addition(A=division_41, B=1)
multiplication_27 = Multiplication(A=division_41, B=1.5)
addition_14 = Addition(A=multiplication_27, B=1)
multiplication_28 = Multiplication(A=addition_14, B=Slider(4, range=0..12))
multiplication_29 = Multiplication(A=addition_12, B=Slider(4, range=0..6))
multiplication_30 = Multiplication(A=addition_13, B=B)
multiplication_31 = Multiplication(A=addition_13, B=B_2)

multiplication_32 = Multiplication(A=deconstruct_domain_12.Start, B=multiplication_30)
multiplication_33 = Multiplication(A=deconstruct_domain_10.Start, B=multiplication_31)
addition_15 = Addition(A=multiplication_32, B=multiplication_33)

multiplication_34 = Multiplication(A=deconstruct_domain_10.Start, B="3")
addition_16 = Addition(A=deconstruct_domain_12.Start, B=multiplication_34)
addition_17 = Addition(A=addition_16, B=deconstruct_domain_11.Start)
addition_18 = Addition(A=multiplication_34, B=addition_17)

vector_xyz_2 = VectorXYZ(XComponent=0, YComponent=addition_16, ZComponent=addition_18)  # -> Vector, Length
move_5 = Move(Geometry=geometry_2, Motion=vector_xyz_2.Vector)  # -> Geometry, Transform

weldmesh_2 = WeldMesh(Mesh=mesh_join_4, Radius=1e-10, Align=False, Use_RTree=False)
multiplication_35 = Multiplication(A=deconstruct_domain_12.End, B=addition_12)

multiplication_36 = Multiplication(A=deconstruct_domain_12.Start, B=multiplication_29)
multiplication_37 = Multiplication(A=deconstruct_domain_10.Start, B=multiplication_28)
addition_19 = Addition(A=multiplication_37, B=multiplication_36)
division_42 = Division(A=addition_19, B=2)
addition_20 = Addition(A=deconstruct_domain_11.Start, B=division_42)
vector_xyz_3 = VectorXYZ(XComponent=multiplication_35, YComponent=addition_15, ZComponent=addition_20)  # -> Vector, Length
move_6 = Move(Geometry=geometry_2, Motion=vector_xyz_3.Vector)  # -> Geometry, Transform
mirror_17 = Mirror(Geometry=move_6.Geometry, Plane=PlaneYZ(0, 0, 0))  # -> Geometry, Transform

stream_filter_12 = StreamFilter(Gate=ⵙꕤⵙ_ⵙᴥⵙ_ⵙᴥⵙꖴⵙᙏⵙ_ⵙ_ⵙᙏⵙꖴⵙᴥⵙ_ⵙᴥⵙ_ⵙꕤⵙ, Stream0=move_5.Geometry, Stream1=[move_6.Geometry, mirror_17.Geometry])

polar_array_5 = PolarArray(Geometry=stream_filter_12, Plane=PlaneXY(0, 0, 0), Count=4, Angle=6.283185307)  # -> Geometry, Transform
rotate_11 = Rotate(Geometry=polar_array_5.Geometry, Angle=1.570796327, Plane=PlaneYZ(0, 0, 0))  # -> Geometry, Transform
polar_array_6 = PolarArray(Geometry=polar_array_5.Geometry, Plane=Plane(origin=(0, 0, 0), x=(0, 0, 1), y=(1, 0, 0)), Count=4, Angle=6.283185307)  # -> Geometry, Transform
rotate_12 = Rotate(Geometry=polar_array_5.Geometry, Angle=1.570796327, Plane=Plane(origin=(0, 0, 0), x=(0, -1, 0), y=(0, 0, 1)))  # -> Geometry, Transform

geometry_4 = Geometry(flatten([polar_array_6.Geometry, rotate_12.Geometry, rotate_11.Geometry]))
bounding_box_8 = BoundingBox(Content=geometry_4, Plane=PlaneXY(0, 0, 0), UnionBox=True)  # -> Box, Box_2
deconstruct_box_6 = DeconstructBox(Box=bounding_box_8.Box)  # -> Plane, X, Y, Z
export_file_to_path_2 = ExportFileToPath(Run=Toggle(False), GeometryToExport=geometry_4, ExportPath="C:\JBO.BB42.XHG.FXD.FXD.DXF.DXF.GHX.24BB.OBJ")
panel_125 = Panel(deconstruct_box_6.X)

ungroup = Ungroup(Group=geometry_4)  # -> flatten(Objects)
bounding_box_9 = BoundingBox(Content=ungroup, Plane=PlaneXY(0, 0, 0), UnionBox=True)  # -> Box, Box_2
mesh_join_5 = MeshJoin(Meshes=ungroup)  # -> flatten(Mesh)
deconstruct_box_7 = DeconstructBox(Box=bounding_box_9.Box)  # -> Plane, X, Y, Z

export_as = ExportAs(
    Geometry=mesh_join_5,
    FileLocation="C:\JBO.BB42.XHG.JBO.PIH.FXD.FXD.DXF.DXF.HIP.OBJ.GHX.24BB.OBJ",
    Overwrite=Toggle(False),
    Export=Toggle(False),
    CompMode=False,
    LastSaveLocalization="neutral,N")  # -> OK, ExportCommand
