# Grasshopper definition XHG.⚪꞉⚪⊚⚪ᔓᔕ⚪ᗱᗴ⚪ᙁ⚪ᑐᑕ⚪ᴥ⚪ꖴ⚪ᑐᑕ⚪◯⚪✤⚪ИN⚪ᗱᗴ⚪ᕤᕦ⚪ИN⚪ᗩ⚪✤⚪◯⚪ᙁ⚪ᗩ⚪ꖴ⚪ᗝ⚪ᗩ⚪ᴥ⚪◌⚪◌⚪◌⚪◌⚪◌⚪◌⚪ᴥ⚪ᗩ⚪ᗝ⚪ꖴ⚪ᗩ⚪ᙁ⚪◯⚪✤⚪ᗩ⚪ИN⚪ᕤᕦ⚪ᗱᗴ⚪ИN⚪✤⚪◯⚪ᑐᑕ⚪ꖴ⚪ᴥ⚪ᑐᑕ⚪ᙁ⚪ᗱᗴ⚪ᔓᔕ⚪⊚⚪꞉⚪.GHX (Grasshopper 1.0.7)
# plug-ins: Palette, CurvePlus

colour_swatch = ColourSwatch(SwatchColor=RGB(115, 115, 115))
colour_swatch_2 = ColourSwatch(SwatchColor=RGB(209, 209, 209))
colour_swatch_3 = ColourSwatch(SwatchColor=RGB(222, 222, 222))
colour_swatch_4 = ColourSwatch(SwatchColor=RGB(168, 168, 168))
colour_swatch_5 = ColourSwatch(SwatchColor=RGB(255, 255, 255))
colour_swatch_6 = ColourSwatch(SwatchColor=RGB(227, 227, 227))
palette = Palette(
    ModeCustomStandard=True,
    Component_Normal_Deselected_Fill_Color=colour_swatch_5,
    Component_Normal_Deselected_Edge_Color=colour_swatch_2,
    Component_Normal_Deselected_Text_Color=colour_swatch,
    Component_Normal_Selected_Fill_Color=colour_swatch_6,
    Component_Normal_Selected_Edge_Color=colour_swatch_2,
    Component_Normal_Selected_Text_Color=colour_swatch,
    Component_Hidden_Deselected_Fill_Color=colour_swatch_5,
    Component_Hidden_Deselected_Edge_Color=colour_swatch_2,
    Component_Hidden_Deselected_Text_Color=colour_swatch,
    Component_Hidden_Selected_Fill_Color=colour_swatch_6,
    Component_Hidden_Selected_Edge_Color=colour_swatch_2,
    Component_Hidden_Selected_Text_Color=colour_swatch,
    Component_Disabled_Deselected_Fill_Color=ColourSwatch(SwatchColor=RGB(196, 196, 196)),
    Component_Disabled_Deselected_Edge_Color=colour_swatch_2,
    Component_Disabled_Deselected_Text_Color=colour_swatch,
    Component_Disabled_Selected_Fill_Color=ColourSwatch(SwatchColor=RGB(176, 176, 176)),
    Component_Disabled_Selected_Edge_Color=colour_swatch_2,
    Component_Disabled_Selected_Text_Color=colour_swatch,
    Component_Warning_Deselected_Fill_Color=colour_swatch_5,
    Component_Warning_Deselected_Edge_Color=colour_swatch_2,
    Component_Warning_Deselected_Text_Color=colour_swatch,
    Component_Warning_Selected_Fill_Color=colour_swatch_6,
    Component_Warning_Selected_Edge_Color=colour_swatch_2,
    Component_Warning_Selected_Text_Color=colour_swatch,
    Component_Error_Deselected_Fill_Color=colour_swatch_5,
    Component_Error_Deselected_Edge_Color=colour_swatch_2,
    Component_Error_Deselected_Text_Color=colour_swatch,
    Component_Error_Selected_Fill_Color=RGB(255, 255, 255),
    Component_Error_Selected_Edge_Color=colour_swatch_2,
    Component_Error_Selected_Text_Color=colour_swatch,
    Component_Label_Deselected_Fill_Color=RGB(50, 50, 50),
    Component_Label_Deselected_Edge_Color=colour_swatch_2,
    Component_Label_Deselected_Text_Color=colour_swatch,
    Component_Label_Selected_Fill_Color=RGB(25, 60, 25),
    Component_Label_Selected_Edge_Color=colour_swatch_2,
    Component_Label_Selected_Text_Color=colour_swatch,
    Galapagos_Deselected_Fill_Color=RGB(252, 252, 252),
    Galapagos_Deselected_Edge_Color=colour_swatch_2,
    Galapagos_Selected_Fill_Color=RGB(255, 255, 255),
    Galapagos_Selected_Edge_Color=colour_swatch_2,
    Wire_Normal_Color=colour_swatch_3,
    Wire_Empty_Color=colour_swatch_3,
    Wire_Selected_Start_Color=colour_swatch_4,
    Wire_Selected_End_Color=colour_swatch_4,
    Panel_Default_Color=RGB(255, 255, 255),
    Group_Default_Color=RGB(255, 255, 255),
    Canvas_Background_Color=RGB(255, 255, 255),
    Canvas_Gridline_Color=RGB(240, 240, 240),
    Canvas_Gridline_Width=2,
    Canvas_Gridline_Height=2,
    Canvas_Edge_Color=RGB(207, 207, 207),
    Canvas_Shadow_Color=RGBA(237, 237, 237, 0),
    Canvas_Shadow_Size=2,
    MonochromaticOnOff=False,
    Monochromatic_Color=RGB(255, 255, 255))
infoglasses = InfoGlasses(
    Run=True,
    Language=0,
    BackGroundColor=RGB(255, 255, 255),
    BoundaryColor=RGB(115, 115, 115),
    English=True,
    FullName_Category=True,
    Merge_Box=True,
    TextColor=RGB(59, 59, 59),
    assemBoxWidth=1000,
    assemFontSize=8,
    assemSet=False,
    assemboxHeight=0,
    autoHeight=False,
    avoidPro=True,
    cateSet=False,
    highLightRadius=2,
    nameBoxDistance=1,
    nameBoxFontSize=8,
    showName=False,
    showNickName=False,
    showPlugin=False)  # disabled

digit_scroller = DigitScroller(Scroller_Digits=12, Scroller_Prefix=" ", Scroller_Radix=4, Scroller_Value=16)
digit_scroller_2 = DigitScroller(Scroller_Digits=12, Scroller_Prefix=" ", Scroller_Radix=11, Scroller_Value=0)
digit_scroller_3 = DigitScroller(Scroller_Digits=12, Scroller_Prefix=" ", Scroller_Radix=4, Scroller_Value=16)
digit_scroller_4 = DigitScroller(Scroller_Digits=12, Scroller_Prefix=" ", Scroller_Radix=2, Scroller_Value=1)
point = Point(Point(0, 0, 0))

number = Number(digit_scroller_3)
number_2 = Number(digit_scroller)
number_3 = Number(digit_scroller_4)
point_2 = Point(point)
number_4 = Number(digit_scroller_2)
boolean = Boolean(Toggle(True))
boolean_2 = Boolean(Toggle(True))
boolean_3 = Boolean(Toggle(True))
boolean_4 = Boolean(Toggle(False))

inscribed_polygon = InscribedPolygon(Plane=PlaneXY(0, 0, 0), Radius=1, Sides=number)
expression = Expression(O=number, Expression="(SIN((4*ATAN(1))/O)/(1+SIN((4*ATAN(1))/O)))")
series = Series(Start=1, Step=1, Count=expr("X-1", number_2))
circle = Circle(Plane=point_2, Radius=number_3)
end_points = EndPoints(Curve=circle)  # -> Start, End
circumscribed_polygon = CircumscribedPolygon(Plane=point_2, Radius=number_3, Sides=number)
subtraction = Subtraction(A=digit_scroller_3, B=number_4)
division = Division(A=digit_scroller_3, B=subtraction)
stream_filter = StreamFilter(Gate=boolean_3, Stream1=circumscribed_polygon)
explode = Explode(Curve=stream_filter, Recursive=True)  # -> Segments, Vertices
division_2 = Division(A=number_3, B=number)
scale = Scale(Geometry=circle, Center=end_points.Start, Factor=expression)  # -> Geometry, Transform
area = Area(Geometry=circle)  # -> Area, Centroid
expression_2 = Expression(O=number, Expression="TAN(((4*ATAN(1))*(O-2))/(4*((O))))^2")
list_item = ListItem(List=explode.Segments, Index=-1, Wrap=True)
scale_2 = Scale(Geometry=list_item, Center=area.Centroid, Factor=expression_2)  # -> Geometry, Transform
power = Power(A=expression_2, B=series)
scale_3 = Scale(Geometry=scale.Geometry, Center=area.Centroid, Factor=power)  # -> Geometry, Transform
stream_filter_2 = StreamFilter(Gate=boolean_4, Stream0=scale_2.Geometry)
merge = Merge(Data1=list_item, Data2=scale_2.Geometry)
merge_2 = Merge(Data1=scale.Geometry, Data2=scale_3.Geometry)
stream_filter_3 = StreamFilter(Gate=boolean_4, Stream0=list_item)
flip_curve = FlipCurve(Curve=stream_filter_2)  # -> Curve, Flag
end_points_2 = EndPoints(Curve=merge)  # -> Start, End
stream_filter_4 = StreamFilter(Gate=boolean_4, Stream0=end_points_2.End)
stream_filter_5 = StreamFilter(Gate=boolean_4, Stream0=end_points_2.Start)
polyline = PolyLine(Vertices=stream_filter_5, Closed=False)
polyline_2 = PolyLine(Vertices=stream_filter_4, Closed=False)
flip_curve_2 = FlipCurve(Curve=polyline)  # -> Curve, Flag
greyville_points = GreyvillePoints(Curve=flip_curve_2.Curve)  # -> Points, Parameters
merge_3 = Merge(Data1=stream_filter_3, Data2=polyline_2, Data3=flip_curve.Curve, Data4=flip_curve_2.Curve)
merge_4 = Merge(Data1=end_points_2.Start, Data2=reverse(end_points_2.End))  # -> reverse(Result)
stream_filter_6 = StreamFilter(Gate=boolean_4, Stream1=merge_4)
point_list = PointList(Points=greyville_points.Points, Size=division_2)
join_curves = JoinCurves(Curves=merge_3, Preserve=True)
construct_mesh = ConstructMesh(Vertices=stream_filter_6, Faces={A=0, B=1, C=2, D=3})
point_list_2 = PointList(Points=merge_4, Size=division_2)
scale_4 = Scale(Geometry=construct_mesh, Center=point_2, Factor=power)  # -> Geometry, Transform
scale_5 = Scale(Geometry=join_curves, Center=point_2, Factor=power)  # -> Geometry, Transform
division_3 = Division(A=number, B=division)
division_4 = Division(A=number, B=division)
merge_5 = Merge(Data1=construct_mesh, Data2=scale_4.Geometry)
merge_6 = Merge(Data1=join_curves, Data2=scale_5.Geometry)

polar_array = PolarArray(Geometry=merge_2, Plane=point_2, Count=division_4, Angle=expr("360/X", degrees(division)))  # -> Geometry, Transform
polar_array_2 = PolarArray(Geometry=merge_6, Plane=point_2, Count=division_3, Angle=expr("360/X", degrees(division)))  # -> Geometry, Transform
polar_array_3 = PolarArray(Geometry=merge_5, Plane=point_2, Count=division_3, Angle=expr("360/X", degrees(division)))  # -> Geometry, Transform
mesh_join = MeshJoin(Meshes=flatten(polar_array_3.Geometry))

stream_filter_7 = StreamFilter(Gate=boolean_4, Stream0=polar_array_2.Geometry, Stream1=mesh_join)
stream_filter_8 = StreamFilter(Gate=boolean, Stream1=polar_array.Geometry)
stream_filter_9 = StreamFilter(Gate=boolean, Stream1=stream_filter_7)

rotate = Rotate(Geometry=stream_filter_8, Angle=expr("180/X", degrees(number)), Plane=point_2)  # -> Geometry, Transform
rotate_2 = Rotate(Geometry=stream_filter_9, Angle=expr("180/X", degrees(number)), Plane=point_2)  # -> Geometry, Transform

stream_filter_10 = StreamFilter(Gate=boolean, Stream0=polar_array.Geometry, Stream1=rotate.Geometry)
stream_filter_11 = StreamFilter(Gate=boolean, Stream0=stream_filter_7, Stream1=rotate_2.Geometry)

expression_3 = Expression(O=number, Expression="COS(4*ATAN(1)/O)")
scale_6 = Scale(Geometry=stream_filter_10, Center=point_2, Factor=expression_3)  # -> Geometry, Transform
scale_7 = Scale(Geometry=stream_filter_11, Center=point_2, Factor=expression_3)  # -> Geometry, Transform

stream_filter_12 = StreamFilter(Gate=boolean_2, Stream0=stream_filter_10, Stream1=scale_6.Geometry)
stream_filter_13 = StreamFilter(Gate=boolean_2, Stream0=stream_filter_11, Stream1=scale_7.Geometry)
