# Grasshopper definition XHꓨ. 𓇬◦୦◦◯◦୦◦⎈⬡⎈◦୦◦◯◦୦◦𓇬 𓇬◦୦◦◯◦୦◦⎈⬡⎈◦୦◦◯◦୦◦𓇬 .GHX (Grasshopper 1.0.7)
# plug-ins: CurvePlus, Anemone, Pancake, GhPython Script, GraphicPlus, BubalusGH2.0, Heteroptera, Bulge, Kangaroo2 Components, Weaverbird, BullAnt, Pufferfish, Flexibility.Gh-by Ehsan, BlueOrange

line_sdl = LineSDL(Location=Point(0, 0, 0), Direction=Vector(0, 1, 0), StartLength=0.5, EndLength=0.5)
polar_array = PolarArray(Geometry=line_sdl, Plane=PlaneXY(0, 0, 0), Count=3, Angle=6.283185307)  # -> Geometry, Transform
point = Point(Point(0, 0, 0))
digit_scroller = DigitScroller(Scroller_Digits=12, Scroller_Prefix="Digit Scroller", Scroller_Radix=11, Scroller_Value=3)
true_only_button = TrueOnlyButton(LastSaveLocalization="neutral,N")
true_only_button_2 = TrueOnlyButton(LastSaveLocalization="neutral,N")
merge = Merge(Data1=true_only_button_2, Data2=digit_scroller)
point_2 = Point(Point(0, 0, 0))
negative = Negative(Value=".5/729")
merge_2 = Merge(Data1=".5/729", Data2=negative)  # -> graft(Result)
digit_scroller_2 = DigitScroller(Scroller_Digits=12, Scroller_Prefix="Digit Scroller", Scroller_Radix=11, Scroller_Value=2)
number_slider = Slider(0, range=0..1)
colour_swatch = ColourSwatch(SwatchColor=RGB(245, 245, 245))
number = Number(merge_2)
vector_xyz = VectorXYZ(XComponent=0, YComponent=0, ZComponent=number)  # -> Vector, Length
colour_swatch_2 = ColourSwatch(SwatchColor=RGBA(255, 255, 255, 0))
digit_scroller_3 = DigitScroller(Scroller_Digits=12, Scroller_Prefix="Digit Scroller", Scroller_Radix=1, Scroller_Value=0.4553415)
digit_scroller_4 = DigitScroller(Scroller_Digits=12, Scroller_Prefix="Digit Scroller", Scroller_Radix=1, Scroller_Value=1)
circumscribed_polygon = CircumscribedPolygon(Plane=PlaneXY(0, 0, 0), Radius="1/6*(1+SQRT(3))", Sides=6)
digit_scroller_5 = DigitScroller(Scroller_Digits=12, Scroller_Prefix="Digit Scroller", Scroller_Radix=1, Scroller_Value=1)
digit_scroller_6 = DigitScroller(Scroller_Digits=12, Scroller_Prefix="Digit Scroller", Scroller_Radix=1, Scroller_Value=0.921120864)
scale = Scale(Geometry=circumscribed_polygon, Center=Point(0, 0, 0), Factor=digit_scroller_6)  # -> Geometry, Transform
boundary_surfaces = BoundarySurfaces(Edges=scale.Geometry)
number_slider_2 = Slider(3, range=0..10)
plane = Plane(PlaneXY(0, 0, 0))
rotate = Rotate(Geometry=plane, Angle=degrees(30), Plane=PlaneXY(0, 0, 0))  # -> Geometry, Transform
plane_2 = Plane(PlaneXY(0, 0, 0))
rotate_2 = Rotate(Geometry=plane_2, Angle=degrees(30), Plane=PlaneXY(0, 0, 0))  # -> Geometry, Transform
digit_scroller_7 = DigitScroller(Scroller_Digits=12, Scroller_Prefix="Digit Scroller", Scroller_Radix=11, Scroller_Value=1)
digit_scroller_8 = DigitScroller(Scroller_Digits=12, Scroller_Prefix="Digit Scroller", Scroller_Radix=11, Scroller_Value=2)
division = Division(A=Slider(1, range=0..1), B=2)
circumscribed_polygon_2 = CircumscribedPolygon(Plane=PlaneXY(0, 0, 0), Radius=division, Sides=6)
circle = Circle(Plane=PlaneXY(0, 0, 0), Radius=division)
geometry = Geometry(circle)
geometry_2 = Geometry(circle)
scale_2 = Scale(Geometry=circle, Center=Point(0, 0, 0), Factor=digit_scroller_5)  # -> Geometry, Transform
division_2 = Division(A=Slider(1, range=0..1), B=2)
expression = Expression(O=division_2, Expression="O*(SQRT(3)/2)")
expression_2 = Expression(O=division_2, Expression="O/(SQRT(3)/2)")
inscribed_polygon = InscribedPolygon(Plane=PlaneXY(0, 0, 0), Radius=expression_2, Sides=6)
tri_fan_polyline = TriFanPolyline(Polyline=inscribed_polygon)
list_item = ListItem(List=tri_fan_polyline, Index=1, Wrap=True)
stream_filter = StreamFilter(Gate=number_slider, Stream0=list_item, Stream1=tri_fan_polyline)
extrude = Extrude(Base=stream_filter, Direction=vector_xyz.Vector)
brep_join = BrepJoin(Breps=flatten(extrude))  # -> Breps, Closed
cap_holes = CapHoles(Brep=brep_join.Breps)
circumscribed_polygon_3 = CircumscribedPolygon(Plane=PlaneXY(0, 0, 0), Radius=expression_2, Sides=6)
scale_3 = Scale(Geometry=circumscribed_polygon_3, Center=Point(0, 0, 0), Factor=0.5)  # -> Geometry, Transform
geometry_3 = Geometry(scale_3.Geometry)
tri_fan_polyline_2 = TriFanPolyline(Polyline=scale_3.Geometry)
weaverbird_s_mesh_edges = WeaverbirdsMeshEdges(MeshOrPolylines=tri_fan_polyline_2)
circle_2 = Circle(Plane=PlaneXY(0, 0, 0), Radius=division_2)
curve_display = CurveDisplay(Curves=circle_2, Thickness=1, Color=RGB(255, 0, 0))  # disabled
loop_start = LoopStart(Repeat=digit_scroller, Trigger=merge, Data=circle_2)  # -> port, Counter, Data
geometry_4 = Geometry(graft(circle_2))
rotate_3 = Rotate(Geometry=circle_2, Angle=1.570796327, Plane=PlaneXY(0, 0, 0))  # -> Geometry, Transform
divide_curve = DivideCurve(Curve=rotate_3.Geometry, Count=6, Kinks=False)  # -> Points, Tangents, Parameters
scale_4 = Scale(Geometry=divide_curve.Points, Center=Point(0, 0, 0), Factor=0.75)  # -> Geometry, Transform
scale_5 = Scale(Geometry=graft(circle_2), Center=flatten(scale_4.Geometry), Factor=0.1111111111)  # -> Geometry, Transform
scale_6 = Scale(Geometry=divide_curve.Points, Center=Point(0, 0, 0), Factor=1)  # -> Geometry, Transform
scale_7 = Scale(Geometry=divide_curve.Points, Center=Point(0, 0, 0), Factor=0.75)  # -> Geometry, Transform
scale_8 = Scale(Geometry=graft(scale_5.Geometry), Center=flatten(scale_7.Geometry), Factor=0.1111111111)  # -> Geometry, Transform
merge_3 = Merge(Data1=scale_6.Geometry, Data2=point_2)
scale_9 = Scale(Geometry=graft(loop_start.Data), Center=flatten(merge_3), Factor=0.3333333333)  # -> Geometry, Transform
scale_10 = Scale(Geometry=divide_curve.Points, Center=Point(0, 0, 0), Factor=0.75)  # -> Geometry, Transform
scale_11 = Scale(Geometry=graft(scale_8.Geometry), Center=flatten(scale_10.Geometry), Factor=0.1111111111)  # -> Geometry, Transform
loop_end = LoopEnd(port=loop_start.port, Exit=False, Data=scale_9.Geometry, TimeOutVal=0, pausedState=False, state="Last & Record")
geometry_5 = Geometry(loop_end)
curve_display_2 = CurveDisplay(Curves=geometry_5, Thickness=1)  # disabled
expression_3 = Expression(O=digit_scroller_7, Expression="6*3^O")
inscribed_polygon_2 = InscribedPolygon(Plane=rotate.Geometry, Radius=division, Sides=6)
geometry_6 = Geometry(inscribed_polygon_2)
stream_filter_2 = StreamFilter(Gate=1, Stream0=geometry, Stream1=geometry_6)
geometry_7 = Geometry(stream_filter_2)
scale_12 = Scale(Geometry=geometry_7, Center=Point(0, 0, 0), Factor=digit_scroller_4)  # -> Geometry, Transform
boundary_surfaces_2 = BoundarySurfaces(Edges=scale_12.Geometry)
scale_13 = Scale(Geometry=circumscribed_polygon_2, Center=Point(0, 0, 0), Factor=0.6666666667)  # -> Geometry, Transform
list_item_2 = ListItem(List=scale_13.Geometry, Index=5, Wrap=True)
circumscribed_polygon_4 = CircumscribedPolygon(Plane=rotate_2.Geometry, Radius=division, Sides=6)
tri_fan_polyline_3 = TriFanPolyline(Polyline=circumscribed_polygon_4)
expression_4 = Expression(I=digit_scroller_8, Expression="(3^I)/(4+(9/2)*(3^(I-1)-1))")
addition = Addition(A=digit_scroller_8, B=1)
deconstruct_arc = DeconstructArc()  # -> BasePlane, Radius, Angle
tri_fan_polyline_4 = TriFanPolyline(Polyline=circumscribed_polygon_2)
simple_mesh = SimpleMesh(Brep=tri_fan_polyline_4)
number_slider_3 = Slider(1, range=0..1)
digit_scroller_9 = DigitScroller(Scroller_Digits=12, Scroller_Prefix="Digit Scroller", Scroller_Radix=11, Scroller_Value=0)

scale_14 = Scale(Geometry=list_item_2, Center=Point(0, 0, 0), Factor="SQRT(3)/2")  # -> Geometry, Transform

number_slider_4 = Slider(0, range=0..2)
number_slider_5 = Slider(3, range=0..10)
divide_curve_2 = DivideCurve(Curve=geometry_3, Count=expression_3, Kinks=False)  # -> Points, Tangents, Parameters
power = Power(A="2", B="8")
scale_15 = Scale(Geometry=circle, Center=Point(0, 0, 0), Factor=0.3333333333)  # -> Geometry, Transform
scale_16 = Scale(Geometry=circumscribed_polygon_2, Center=Point(0, 0, 0), Factor=0.3333333333)  # -> Geometry, Transform
scale_17 = Scale(Geometry=circle, Center=Point(0, 0, 0), Factor=0.6666666667)  # -> Geometry, Transform
panel = Panel("3/4")
construct_domain = ConstructDomain(DomainStart=expr("-X", division_2), DomainEnd=division_2)
rectangle = Rectangle(Plane=PlaneXY(0, 0, 0), XSize=construct_domain, YSize=construct_domain, Radius=0)  # -> Rectangle, Length
divide_curve_3 = DivideCurve(Curve=rectangle.Rectangle, Count=8, Kinks=False)  # -> Points, Tangents, Parameters
negative_2 = Negative(Value=addition)
true_only_button_3 = TrueOnlyButton(LastSaveLocalization="neutral,N")
scale_18 = Scale(Geometry=inscribed_polygon_2, Center=Point(0, 0, 0), Factor=0.3333333333)  # -> Geometry, Transform
scale_19 = Scale(Geometry=inscribed_polygon_2, Center=Point(0, 0, 0), Factor=0.6666666667)  # -> Geometry, Transform
digit_scroller_10 = DigitScroller(Scroller_Digits=12, Scroller_Prefix="Digit Scroller", Scroller_Radix=1, Scroller_Value=0.1005000001)
division_3 = Division(A="10", B="9")  # disabled
scale_20 = Scale(Geometry=geometry_3, Center=Point(0, 0, 0), Factor=division_3)  # -> Geometry, Transform; disabled
line = Line(Line((0, 0.1666666667, 0), (0, 0.5, 0)))
merge_4 = Merge(Data1=true_only_button_3, Data2=digit_scroller_9)
loop_start_2 = LoopStart(Repeat=digit_scroller_9, Trigger=merge_4, Data=circle_2)  # -> port, Counter, Data
mesh_join = MeshJoin(Meshes=simple_mesh)
mesh_edges = MeshEdges(Mesh=mesh_join)  # -> NakedEdges, InteriorEdges, NonManifoldEdges
scale_21 = Scale(Geometry=mesh_edges.InteriorEdges, Center=Point(0, 0, 0), Factor=2)  # -> Geometry, Transform
join_curves = JoinCurves(Curves=scale_21.Geometry, Preserve=False)
power_2 = Power(A="2", B="-16")
scale_22 = Scale(Geometry=circle_2, Center=Point(0, 0, 0), Factor=1)  # -> Geometry, Transform
scale_23 = Scale(Geometry=scale_22.Geometry, Center=Point(0, 0, 0), Factor=1)  # -> Geometry, Transform
power_3 = Power(A="3", B=negative_2)
list_item_3 = ListItem(List=join_curves, Index=1, Wrap=True)
vector = Vector(list_item_3)
scale_24 = Scale(Geometry=vector, Center=Point(0, 0, 0), Factor="2/SQRT(3)")  # -> Geometry, Transform
multiplication = Multiplication(A=list_item_3, B=2)
geometry_8 = Geometry(polar_array.Geometry)
multiplication_2 = Multiplication(A="36", B="1.6666666666666666")  # disabled
panel_2 = Panel("""3/4
9/13
27/40
81/121""")
list_item_4 = ListItem(List=scale_13.Geometry, Index=5, Wrap=True)
explode = Explode(Curve=list_item_4, Recursive=True)  # -> Segments, Vertices
division_4 = Division(A="8", B="9")  # disabled
scale_25 = Scale(Geometry=geometry_3, Center=Point(0, 0, 0), Factor=division_4)  # -> Geometry, Transform; disabled
list_item_5 = ListItem(List=explode.Segments, Index=5, Wrap=True)
xz_plane = XZPlane(Origin=Point(0, 0, 0))
digit_scroller_11 = DigitScroller(Scroller_Digits=12, Scroller_Prefix="Digit Scroller", Scroller_Radix=1, Scroller_Value=0.6694214876)
divide_curve_4 = DivideCurve(Curve=scale_20.Geometry, Count=multiplication_2, Kinks=False)  # -> Points, Tangents, Parameters; disabled
scale_26 = Scale(Geometry=divide_curve.Points, Center=Point(0, 0, 0), Factor=expression_4)  # -> Geometry, Transform
true_only_button_4 = TrueOnlyButton(LastSaveLocalization="neutral,N")
divide_curve_5 = DivideCurve(Curve=line, Count=expr("X/1", expression_3), Kinks=False)  # -> Points, Tangents, Parameters
data = Data(scale_15.Geometry)
power_4 = Power(A="3", B="1")
discontinuity = Discontinuity(Curve=inscribed_polygon_2, Level=1)  # -> Points, Parameters
scale_27 = Scale(Geometry=discontinuity.Points, Center=Point(0, 0, 0), Factor="(SQRT(3)/2)/1.5")  # -> Geometry, Transform
rotate_4 = Rotate(Geometry=scale_27.Geometry, Angle=degrees(30), Plane=PlaneXY(0, 0, 0))  # -> Geometry, Transform
stream_filter_3 = StreamFilter(Gate=0, Stream1=rotate_4.Geometry)
merge_5 = Merge(Data1=point, Data2=discontinuity.Points, Data3=stream_filter_3)  # -> flatten(Result)
dotdisplay = DotDisplay(Point=merge_5)
scale_28 = Scale(Geometry=merge_5, Center=Point(0, 0, 0), Factor=0.75)  # -> Geometry, Transform
scale_29 = Scale(Geometry=merge_5, Center=Point(0, 0, 0), Factor=1.333333333)  # -> Geometry, Transform
scale_30 = Scale(Geometry=graft(circle), Center=discontinuity.Points, Factor=0.3333333333)  # -> Geometry, Transform
scale_31 = Scale(Geometry=graft(scale_30.Geometry), Center=discontinuity.Points, Factor=0.3333333333)  # -> Geometry, Transform
curve_display_3 = CurveDisplay(Curves=[scale_30.Geometry, circle, scale_31.Geometry], Thickness=1, Color=RGB(0, 221, 255))  # disabled
tri_fan_polyline_5 = TriFanPolyline(Polyline=scale_19.Geometry)  # disabled
true_only_button_5 = TrueOnlyButton(LastSaveLocalization="neutral,N")
multiplication_3 = Multiplication(A="36", B="1.3333333333333333")  # disabled
digit_scroller_12 = DigitScroller(Scroller_Digits=12, Scroller_Prefix="Digit Scroller", Scroller_Radix=11, Scroller_Value=3)
merge_6 = Merge(Data1=true_only_button_5, Data2=data, Data3=digit_scroller_12)
cull_nth_plus = CullNthPlus(List=divide_curve_5.Points, CullFrequency=2)  # -> RemainList, RemoveList; disabled
scale_32 = Scale(Geometry=graft(loop_start_2.Data), Center=flatten(scale_26.Geometry), Factor=power_3)  # -> Geometry, Transform
divide_curve_6 = DivideCurve(Curve=scale_19.Geometry, Count=12, Kinks=False)  # -> Points, Tangents, Parameters; disabled
cull_nth_plus_2 = CullNthPlus(List=divide_curve_6.Points, CullFrequency=2)  # -> RemainList, RemoveList; disabled
geometry_9 = Geometry(mesh_edges.InteriorEdges)
divide_curve_7 = DivideCurve(Curve=scale_25.Geometry, Count=multiplication_3, Kinks=False)  # -> Points, Tangents, Parameters; disabled
scale_33 = Scale(Geometry=divide_curve_3.Points, Center=Point(0, 0, 0), Factor=0.75)  # -> Geometry, Transform
list_item_6 = ListItem(List=discontinuity.Points, Index=[1, 4], Wrap=True)
divide_curve_8 = DivideCurve(Curve=scale_13.Geometry, Count=12, Kinks=False)  # -> Points, Tangents, Parameters; disabled
division_5 = Division(A="1", B=number_slider_5)
addition_2 = Addition(A=number_slider_3, B=division_5)
scale_34 = Scale(Geometry=scale_13.Geometry, Center=Point(0, 0, 0), Factor=addition_2)  # -> Geometry, Transform
geometry_10 = Geometry(cull_nth_plus_2.RemoveList)  # disabled
geometry_11 = Geometry(cull_nth_plus.RemoveList)
digit_scroller_13 = DigitScroller(Scroller_Digits=12, Scroller_Prefix="Digit Scroller", Scroller_Radix=1, Scroller_Value=1)
subtraction = Subtraction(A=number_slider_3, B=division_5)
scale_35 = Scale(Geometry=scale_13.Geometry, Center=Point(0, 0, 0), Factor=subtraction)  # -> Geometry, Transform
digit_scroller_14 = DigitScroller(Scroller_Digits=12, Scroller_Prefix="Digit Scroller", Scroller_Radix=11, Scroller_Value=2)
loop_start_3 = LoopStart(Repeat=digit_scroller_12, Trigger=merge_6, Data=data)  # -> port, Counter, Data
power_5 = Power(A="2", B="-2")
fast_loop_start = FastLoopStart(Iterations=4, Data=circle_2)  # -> port, Counter, Data
true_only_button_6 = TrueOnlyButton(LastSaveLocalization="neutral,N")
loop_end_2 = LoopEnd(port=loop_start_2.port, Exit=False, Data=scale_32.Geometry, TimeOutVal=0, pausedState=False, state="Output last")
scale_36 = Scale(Geometry=graft(loop_start_3.Data), Center=discontinuity.Points, Factor=0.3333333333)  # -> Geometry, Transform
dotdisplay_2 = DotDisplay(Point=geometry_11)
tri_fan_polyline_6 = TriFanPolyline(Polyline=scale_19.Geometry)
weaverbird_s_split_triangles_subdivision = WeaverbirdsSplitTrianglesSubdivision(MeshCurves=tri_fan_polyline_6, Level=power_4)  # disabled
merge_7 = Merge(Data1=true_only_button_6, Data2=digit_scroller_14)
loop_start_4 = LoopStart(Repeat=digit_scroller_14, Trigger=merge_7, Data=circle_2)  # -> port, Counter, Data
digit_scroller_15 = DigitScroller(Scroller_Digits=12, Scroller_Prefix="Digit Scroller", Scroller_Radix=11, Scroller_Value=4)
scale_37 = Scale(Geometry=inscribed_polygon_2, Center=Point(0, 0, 0), Factor=0.6666666667)  # -> Geometry, Transform
list_item_7 = ListItem(List=list_item_6, Index=0, Wrap=True)
scale_38 = Scale(Geometry=graft(data), Center=list_item_7, Factor=0.3333333333)  # -> Geometry, Transform
loop_end_3 = LoopEnd(port=loop_start_3.port, Exit=False, Data=scale_36.Geometry, TimeOutVal=0, pausedState=False, state="Last & Record")  # -> flatten(Data)
power_6 = Power(A="3", B="1")
number_slider_6 = Slider(1, range=0..1)
tri_fan_polyline_7 = TriFanPolyline(Polyline=scale_19.Geometry)
weaverbird_s_split_triangles_subdivision_2 = WeaverbirdsSplitTrianglesSubdivision(MeshCurves=tri_fan_polyline_7, Level=power_6)  # disabled
power_7 = Power(A="3", B="1")  # disabled
weaverbird_s_split_triangles_subdivision_3 = WeaverbirdsSplitTrianglesSubdivision(MeshCurves=tri_fan_polyline_5, Level=power_7)  # disabled
face_boundaries = FaceBoundaries(Mesh=weaverbird_s_split_triangles_subdivision_3)  # disabled
true_only_button_7 = TrueOnlyButton(LastSaveLocalization="neutral,N")
geometry_12 = Geometry(loop_end_2)
list_item_8 = ListItem(List=loop_end_2, Index=0, Wrap=True)
center = Center(Geometry=flatten(list_item_8), forall=True)  # -> Center, Dimension
scale_39 = Scale(Geometry=list_item_8, Center=center.Center, Factor=0.3333333333)  # -> Geometry, Transform; disabled
scale_40 = Scale(Geometry=list_item_8, Center=center.Center, Factor=0.3333333333)  # -> Geometry, Transform; disabled
scale_41 = Scale(Geometry=graft(loop_start_4.Data), Center=flatten(scale_33.Geometry), Factor=0.1111111111)  # -> Geometry, Transform
multiplication_4 = Multiplication(A=number_slider_5, B=3)
addition_3 = Addition(A=multiplication_4, B=3)
subtraction_2 = Subtraction(A=multiplication_4, B="3")
division_6 = Division(A="1", B=subtraction_2)
subtraction_3 = Subtraction(A=number_slider_3, B=division_6)
scale_42 = Scale(Geometry=scale_35.Geometry, Center=Point(0, 0, 0), Factor=subtraction_3)  # -> Geometry, Transform
division_7 = Division(A="1", B=addition_3)
addition_4 = Addition(A=number_slider_3, B=division_7)
scale_43 = Scale(Geometry=scale_34.Geometry, Center=Point(0, 0, 0), Factor=addition_4)  # -> Geometry, Transform
face_boundaries_2 = FaceBoundaries(Mesh=weaverbird_s_split_triangles_subdivision)
point_3 = Point(Point(0, 0, 0))
rotate_5 = Rotate(Geometry=circle, Angle=1.570796327, Plane=PlaneXY(0, 0, 0))  # -> Geometry, Transform
center_2 = Center(Geometry=flatten(scale_39.Geometry), forall=True)  # -> Center, Dimension; disabled
scale_44 = Scale(Geometry=scale_15.Geometry, Center=Point(0, 0, 0), Factor=1)  # -> Geometry, Transform
face_boundaries_3 = FaceBoundaries(Mesh=weaverbird_s_split_triangles_subdivision_2)
scale_45 = Scale(Geometry=scale_15.Geometry, Center=Point(0, 0, 0), Factor=1)  # -> Geometry, Transform
rotate_6 = Rotate(Geometry=circle, Angle=1.570796327, Plane=PlaneXY(0, 0, 0))  # -> Geometry, Transform
digit_scroller_16 = DigitScroller(Scroller_Digits=12, Scroller_Prefix="Digit Scroller", Scroller_Radix=11, Scroller_Value=3)
digit_scroller_17 = DigitScroller(Scroller_Digits=12, Scroller_Prefix="Digit Scroller", Scroller_Radix=1, Scroller_Value=0.91068352)
scale_46 = Scale(Geometry=graft(fast_loop_start.Data), Center=flatten(divide_curve_3.Points), Factor=0.3333333333)  # -> Geometry, Transform
digit_scroller_18 = DigitScroller(Scroller_Digits=12, Scroller_Prefix="Digit Scroller", Scroller_Radix=11, Scroller_Value=3)
curve_display_4 = CurveDisplay(Curves=list_item_8, Thickness=1, Color=RGB(0, 0, 255))  # disabled
data_2 = Data(face_boundaries_2)
ggnetworkpatch = GgNetworkPatch(Invert=True, Surface=False)
center_3 = Center(Geometry=flatten(scale_40.Geometry), forall=True)  # -> Center, Dimension; disabled
geometry_13 = Geometry(geometry_12)
digit_scroller_19 = DigitScroller(Scroller_Digits=12, Scroller_Prefix="Digit Scroller", Scroller_Radix=11, Scroller_Value=1)
discontinuity_2 = Discontinuity(Curve=inscribed_polygon_2, Level=1)  # -> Points, Parameters
merge_8 = Merge(Data1=point_3, Data2=discontinuity_2.Points)  # -> flatten(Result)

series = Series(Start=0, Step=1, Count=Slider(3, range=0..8))

number_2 = Number(graft(series))

subtraction_4 = Subtraction(A=number_2, B="0")
scale_47 = Scale(Geometry=stream_filter, Center=Point(0, 0, 0), Factor=1)  # -> Geometry, Transform

negative_3 = Negative(Value=number_2)
subtraction_5 = Subtraction(A=negative_3, B="1")
power_8 = Power(A="3", B=negative_3)
power_9 = Power(A="3", B=subtraction_4)
power_10 = Power(A="3", B=subtraction_5)
scale_48 = Scale(Geometry=geometry_4, Center=Point(0, 0, 0), Factor=power_8)  # -> Geometry, Transform
weaverbird_s_split_triangles_subdivision_4 = WeaverbirdsSplitTrianglesSubdivision(MeshCurves=scale_47.Geometry, Level=graft(power_9))  # -> simplify(OutputMeshCurves)
weaverbird_s_vertices_component = WeaverbirdsVerticesComponent(MeshClosedPolylinesGroup=weaverbird_s_split_triangles_subdivision_4, Weld=True)
face_normals = FaceNormals(Mesh=weaverbird_s_split_triangles_subdivision_4)  # -> Centers, Normals
area = Area(Geometry=scale_48.Geometry)  # -> Area, Centroid
division_8 = Division(A=power_8, B=2)
division_9 = Division(A=division_8, B="3")
weave = Weave(Pattern=[0, 1], Stream0=face_normals.Centers, Stream1=weaverbird_s_vertices_component, NullGaps=False)
circle_cnr = CircleCNR(Center=weave, Normal=Vector(0, 0, 1), Radius=division_9)
orient = Orient(Geometry=scale_48.Geometry, Source=area.Centroid, Target=weave)  # -> Geometry, Transform; disabled
point_in_curve = PointInCurve(Point=weave, Curve=geometry_7)  # -> Relationship, Point
scale_49 = Scale(Geometry=circle_cnr, Center=weave, Factor=0.3333333333)  # -> Geometry, Transform
stream_filter_4 = StreamFilter(Gate=1, Stream0="1", Stream1=point_in_curve.Relationship)
deconstruct_arc_2 = DeconstructArc(Arc=circle_cnr)  # -> BasePlane, Radius, Angle; disabled
collision_one_many = CollisionOneMany(Collider=deconstruct_arc_2.BasePlane, Obstacles=boundary_surfaces_2)  # -> Collision, Index; disabled
geometry_14 = Geometry(scale_49.Geometry)
boundary_surfaces_3 = BoundarySurfaces(Edges=geometry_14)  # disabled
area_2 = Area(Geometry=geometry_14)  # -> Area, Centroid; disabled
pipe = Pipe(Curve=weaverbird_s_mesh_edges, Radius=power_10, Caps=0)  # -> flatten(Pipe); disabled
cull_pattern = CullPattern(List=geometry_14, CullPattern=stream_filter_4)
curve_display_5 = CurveDisplay(Curves=cull_pattern, Thickness=1, Color=colour_swatch)  # disabled
merge_9 = Merge(Data1=scale_15.Geometry, Data2=cull_pattern)
deconstruct_arc_3 = DeconstructArc(Arc=merge_9)  # -> BasePlane, Radius, Angle
rotate_7 = Rotate(Geometry=deconstruct_arc_3.BasePlane, Angle=1.570796327, Plane=deconstruct_arc_3.BasePlane)  # -> Geometry, Transform

inscribed_polygon_3 = InscribedPolygon(Plane=rotate_7.Geometry, Radius=deconstruct_arc_3.Radius, Sides=6)

deconstruct_arc_4 = DeconstructArc(Arc=geometry_14)  # -> BasePlane, flatten(Radius), Angle; disabled
collision_one_many_2 = CollisionOneMany(Collider=cull_pattern, Obstacles=scale_12.Geometry)  # -> Collision, Index; disabled

cull_pattern_2 = CullPattern(List=cull_pattern, CullPattern=invert(collision_one_many_2.Collision))  # disabled

collision_one_many_3 = CollisionOneMany(Collider=cull_pattern, Obstacles=weaverbird_s_mesh_edges)  # -> Collision, Index; disabled
cull_pattern_3 = CullPattern(List=cull_pattern, CullPattern=collision_one_many_3.Collision)
geometry_15 = Geometry(cull_pattern)
stream_gate = StreamGate(Stream=geometry_15, Gate=number_slider_4)  # -> Target0, Target1, Target2; disabled
boundary_surfaces_4 = BoundarySurfaces(Edges=flatten(stream_gate.Target1))
boundary_surfaces_5 = BoundarySurfaces(Edges=stream_gate.Target2)
collision_many_many = CollisionManyMany(Colliders=boundary_surfaces_5)  # -> Collision, Indices
cull_pattern_4 = CullPattern(List=boundary_surfaces_5, CullPattern=invert(collision_many_many.Collision))
panel_3 = Panel(deconstruct_arc_4.Radius)
cull_pattern_5 = CullPattern(List=boundary_surfaces_5, CullPattern=collision_many_many.Collision)
curve_display_6 = CurveDisplay(Curves=cull_pattern_3, Thickness=2, Color=RGB(0, 0, 255))  # disabled
deconstruct_arc_5 = DeconstructArc(Arc=cull_pattern_3)  # -> BasePlane, Radius, Angle
min_max = MinMax(Number=deconstruct_arc_5.Radius)  # -> Minimum, Maximum
solid_union = SolidUnion(Breps=cull_pattern_5)
merge_10 = Merge(Data1=cull_pattern_4, Data2=solid_union)
stream_filter_5 = StreamFilter(Gate=number_slider_4, Stream0=stream_gate.Target0, Stream1=boundary_surfaces_4, Stream2=merge_10)  # disabled
proximity_3d = Proximity3D(Points=deconstruct_arc_5.BasePlane, Group=65536, MaxRadius=expr("X*3", min_max.Maximum))  # -> flatten(Links), Topology; disabled
end_points = EndPoints(Curve=proximity_3d.Links)  # -> Start, End
circle_3 = Circle(Plane=end_points.End, Radius=deconstruct_arc_5.Radius)
circle_4 = Circle(Plane=end_points.Start, Radius=deconstruct_arc_5.Radius)
geometry_16 = Geometry(geometry_15)
deconstruct_arc_6 = DeconstructArc(Arc=geometry_16)  # -> BasePlane, Radius, Angle
scale_50 = Scale(Geometry=flatten(deconstruct_arc_6.BasePlane), Center=Point(0, 0, 0), Factor=power_5)  # -> Geometry, Transform
fast_loop_end = FastLoopEnd(port=fast_loop_start.port, Exit=False, Data=scale_46.Geometry, RecordData=False, TimeOutVal=0)  # disabled
tangent_arcs = TangentArcs(CircleA=circle_4, CircleB=circle_3, Radius=min_max.Maximum)  # -> ArcA, ArcB
loop_end_4 = LoopEnd(port=loop_start_4.port, Exit=False, Data=scale_41.Geometry, TimeOutVal=0, pausedState=False, state="Output last")
true_only_button_8 = TrueOnlyButton(LastSaveLocalization="neutral,N")
merge_11 = Merge(Data1=true_only_button_8, Data2=data_2, Data3=digit_scroller_19)
revolution = Revolution(Curve=tangent_arcs.ArcA, Axis=proximity_3d.Links, Domain=Domain(0, 6.283185307))  # disabled
divide_curve_9 = DivideCurve(Curve=rotate_5.Geometry, Count=2, Kinks=False)  # -> Points, Tangents, Parameters
true_only_button_9 = TrueOnlyButton(LastSaveLocalization="neutral,N")
data_3 = Data(data)
multiplication_5 = Multiplication(A=subtraction_2, B=3)
data_4 = Data(scale_45.Geometry)
true_only_button_10 = TrueOnlyButton(LastSaveLocalization="neutral,N")
addition_5 = Addition(A=multiplication_5, B=3)
division_10 = Division(A="1", B=addition_5)
divide_curve_10 = DivideCurve(Curve=rotate_6.Geometry, Count=2, Kinks=False)  # -> Points, Tangents, Parameters
addition_6 = Addition(A=number_slider_3, B=division_10)
scale_51 = Scale(Geometry=scale_43.Geometry, Center=Point(0, 0, 0), Factor=addition_6)  # -> Geometry, Transform
merge_12 = Merge(Data1=true_only_button_10, Data2=data_4, Data3=digit_scroller_15, Data4=divide_curve_10.Points)
digit_scroller_20 = DigitScroller(Scroller_Digits=12, Scroller_Prefix="Digit Scroller", Scroller_Radix=1, Scroller_Value=0.91068352)
geometry_17 = Geometry(geometry_16)
list_item_9 = ListItem(List=discontinuity_2.Points, Index=[1, 4], Wrap=True)
sphere = Sphere(Base=deconstruct_arc_5.BasePlane, Radius=min_max.Maximum)  # disabled
subtraction_6 = Subtraction(A=multiplication_5, B="3")
division_11 = Division(A="1", B=subtraction_6)
digit_scroller_21 = DigitScroller(Scroller_Digits=12, Scroller_Prefix="Digit Scroller", Scroller_Radix=1, Scroller_Value=0.91068352)
subtraction_7 = Subtraction(A=number_slider_3, B=division_11)
scale_52 = Scale(Geometry=scale_42.Geometry, Center=Point(0, 0, 0), Factor=subtraction_7)  # -> Geometry, Transform
digit_scroller_22 = DigitScroller(Scroller_Digits=12, Scroller_Prefix="Digit Scroller", Scroller_Radix=11, Scroller_Value=1)
merge_13 = Merge(Data1=tangent_arcs.ArcA, Data2=tangent_arcs.ArcB)
loop_start_5 = LoopStart(Repeat=digit_scroller_19, Trigger=merge_11, Data=data_2)  # -> port, Counter, Data
geometry_18 = Geometry(loop_end_4)
merge_14 = Merge(Data1=cull_pattern_3, Data2=merge_13)
scale_53 = Scale(Geometry=merge_14, Center=Point(0, 0, 0), Factor=power)  # -> Geometry, Transform; disabled
ggcurvessplitintersect = GgCurvesSplitIntersect(Curves=scale_53.Geometry, Tol=power_2, SplitPoly=True, Splitters=weaverbird_s_mesh_edges)  # -> flatten(Curves); disabled
ggnetworkpatch_2 = GgNetworkPatch(Curves=flatten(ggcurvessplitintersect), Invert=True, Surface=False)  # disabled
region_union = RegionUnion(Curves=flatten(ggnetworkpatch_2))
scale_54 = Scale(Geometry=region_union, Center=Point(0, 0, 0), Factor=expr("1/X", power))  # -> Geometry, Transform
open_curve = OpenCurve(Curve=merge_14, Length=7.629394531e-06, Normalized=False, Seam=0)  # -> Opened, ResultBoolean
geometry_19 = Geometry(scale_54.Geometry)
smooth_corners = SmoothCorners(Curve=geometry_19, Parameter=1, BlendContinuity=1, Close=False)  # disabled
prude_curve = PrudeCurve(Curve=geometry_19, Length=1, BlendType=1, Bulge=0.5)  # -> Prude, ResultBoolean; disabled
loop_start_6 = LoopStart(Repeat=digit_scroller_15, Trigger=merge_12, Data=data_4)  # -> port, Counter, Data
scale_55 = Scale(Geometry=graft(loop_start_5.Data), Center=merge_8, Factor=0.3333333333)  # -> Geometry, Transform
list_item_10 = ListItem(List=list_item_9, Index=0, Wrap=True)
scale_56 = Scale(Geometry=graft(data_2), Center=list_item_10, Factor=0.3333333333)  # -> Geometry, Transform
deconstruct_arc_7 = DeconstructArc(Arc=merge_14)  # -> BasePlane, Radius, Angle
merge_15 = Merge(Data1=sphere, Data2=revolution)

scale_57 = Scale(Geometry=divide_curve_10.Points, Center=Point(0, 0, 0), Factor="SQRT(3)/2")  # -> Geometry, Transform

scale_58 = Scale(Geometry=graft(loop_start_6.Data), Center=scale_57.Geometry, Factor=0.3333333333)  # -> Geometry, Transform
digit_scroller_23 = DigitScroller(Scroller_Digits=12, Scroller_Prefix="Digit Scroller", Scroller_Radix=1, Scroller_Value=0.3849)
multiplication_6 = Multiplication(A=addition_5, B=3)
addition_7 = Addition(A=multiplication_6, B=3)
division_12 = Division(A="1", B=addition_7)
addition_8 = Addition(A=number_slider_3, B=division_12)
scale_59 = Scale(Geometry=scale_51.Geometry, Center=Point(0, 0, 0), Factor=addition_8)  # -> Geometry, Transform
solid_fill = SolidFill(ShapeGeometry=merge_15, Color=RGB(0, 244, 124))
loop_end_5 = LoopEnd(port=loop_start_5.port, Exit=False, Data=scale_55.Geometry, TimeOutVal=0, pausedState=False, state="Last & Record")  # -> flatten(Data); disabled
merge_16 = Merge(Data1=data_2, Data2=loop_end_5)  # -> flatten(Result)
geometry_20 = Geometry(circumscribed_polygon_2)
discontinuity_3 = Discontinuity(Curve=geometry_20, Level=1)  # -> Points, Parameters
power_11 = Power(A="2", B="8")  # disabled
scale_60 = Scale(Geometry=merge_14, Center=Point(0, 0, 0), Factor=power_11)  # -> Geometry, Transform; disabled
division_13 = Division(A="3", B="9")
power_12 = Power(A="2", B="-8")  # disabled
ggcurvessplitintersect_2 = GgCurvesSplitIntersect(Curves=scale_60.Geometry, Tol=power_12, SplitPoly=True)  # -> flatten(Curves); disabled
ggnetworkpatch_3 = GgNetworkPatch(Curves=ggcurvessplitintersect_2, Invert=False, Surface=False)  # disabled
scale_61 = Scale(Geometry=ggnetworkpatch_3, Center=Point(0, 0, 0), Factor=expr("1/X", power_11))  # -> Geometry, Transform; disabled
number_slider_7 = Slider(6, range=0..10)
negative_4 = Negative(Value=division_13)
loop_end_6 = LoopEnd(port=loop_start_6.port, Exit=False, Data=scale_58.Geometry, TimeOutVal=0, pausedState=False, state="Last & Record")
merge_17 = Merge(Data1=data_4, Data2=loop_end_6)  # -> flatten(Result)

number_slider_8 = Slider(0, range=0..1)
stream_gate_2 = StreamGate(Stream=geometry_13, Gate=number_slider_8)  # -> Target0, Target1
solid_fill_2 = SolidFill(ShapeGeometry=stream_gate_2.Target1, Color=RGB(0, 0, 0))
stream_filter_6 = StreamFilter(Gate=number_slider_8, Stream0=stream_gate_2.Target0, Stream1=solid_fill_2)

scale_62 = Scale(Geometry=inscribed_polygon_2, Center=Point(0, 0, 0), Factor=0.6666666667)  # -> Geometry, Transform; disabled
geometry_21 = Geometry()
collision_one_many_4 = CollisionOneMany(Collider=flatten(loop_end_5), Obstacles=flatten(geometry_21))  # -> Collision, Index; disabled
vector_xyz_2 = VectorXYZ(XComponent=division_13, YComponent=0, ZComponent=0)  # -> Vector, Length
yz_plane = YZPlane(Origin=vector_xyz_2.Vector)

geometry_22 = Geometry(scale_15.Geometry)
geometry_23 = Geometry(scale_18.Geometry)  # disabled

vector_xyz_3 = VectorXYZ(XComponent=negative_4, YComponent=0, ZComponent=0)  # -> Vector, Length
series_2 = Series(Start=-30, Step=30, Count=3)
scale_63 = Scale(Geometry=inscribed_polygon_2, Center=Point(0, 0, 0), Factor=0.6666666667)  # -> Geometry, Transform; disabled
custom_preview = CustomPreview(
    Geometry=merge_15,
    Material={diffuse=RGB(171, 171, 171), emission=RGB(51, 51, 51), shine=0.5, specular=RGB(255, 255, 255), transparency=0})
list_item_11 = ListItem(List=loop_end_6, Index=0, Wrap=True)
geometry_24 = Geometry()
collision_one_many_5 = CollisionOneMany(Collider=flatten(loop_end_6), Obstacles=flatten(geometry_24))  # -> Collision, Index
multiplication_7 = Multiplication(A=addition_7, B=3)
addition_9 = Addition(A=multiplication_7, B=3)
division_14 = Division(A="1", B=addition_9)
addition_10 = Addition(A=number_slider_3, B=division_14)
scale_64 = Scale(Geometry=scale_59.Geometry, Center=Point(0, 0, 0), Factor=addition_10)  # -> Geometry, Transform
colour_swatch_3 = ColourSwatch(SwatchColor=RGB(0, 244, 124))
deconstruct_arc_8 = DeconstructArc(Arc=list_item_11)  # -> BasePlane, Radius, Angle
scale_65 = Scale(Geometry=list_item_11, Center=deconstruct_arc_8.BasePlane, Factor=0.3333333333)  # -> Geometry, Transform
curve_display_7 = CurveDisplay(Curves=merge_14, Thickness=2, Color=RGB(0, 0, 255))  # disabled
mirror_plane = MirrorPlane(PlaneYZ(0, 0, 0))
rotate_8 = Rotate(Geometry=mirror_plane, Angle=graft(degrees(series_2)), Plane=PlaneXY(0, 0, 0))  # -> Geometry, Transform
rotate_9 = Rotate(Geometry=loop_end_6, Angle=degrees(-30), Plane=PlaneXY(0, 0, 0))  # -> Geometry, Transform
orient_2 = Orient(Geometry=scale_39.Geometry, Source=center_2.Center, Target=divide_curve_4.Points)  # -> Geometry, Transform; disabled
deconstruct_arc_9 = DeconstructArc(Arc=geometry_22)  # -> BasePlane, Radius, Angle
rotate_10 = Rotate(Geometry=deconstruct_arc_9.BasePlane, Angle=degrees(-90), Plane=deconstruct_arc_9.BasePlane)  # -> Geometry, Transform
inscribed_polygon_4 = InscribedPolygon(Plane=rotate_10.Geometry, Radius=deconstruct_arc_9.Radius, Sides=number_slider_7)
scale_66 = Scale(Geometry=inscribed_polygon_4, Center=Point(0, 0, 0), Factor=1)  # -> Geometry, Transform
move = Move(Geometry=scale_66.Geometry, Motion=Vector(0, 0.3333333333, 0))  # -> Geometry, Transform
rotate_11 = Rotate(Geometry=move.Geometry, Angle=degrees(-60), Plane=PlaneXY(0, 0, 0))  # -> Geometry, Transform; disabled
scale_67 = Scale(Geometry=inscribed_polygon_4, Center=Point(0, 0, 0), Factor=3)  # -> Geometry, Transform; disabled
polar_array_2 = PolarArray(Geometry=move.Geometry, Plane=PlaneXY(0, 0, 0), Count=6, Angle=6.283185307)  # -> Geometry, Transform
merge_18 = Merge(Data1=scale_66.Geometry, Data2=polar_array_2.Geometry, Data3=scale_67.Geometry)  # -> flatten(Result)
orient_3 = Orient(Geometry=list_item_8, Source=center.Center, Target=divide_curve_2.Points)  # -> Geometry, Transform; disabled
panel_4 = Panel("2/(3*SQRT(3))/2")
geometry_25 = Geometry([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])
digit_scroller_24 = DigitScroller(Scroller_Digits=12, Scroller_Prefix="Digit Scroller", Scroller_Radix=1, Scroller_Value=0.2222222222)
orient_4 = Orient(Geometry=scale_40.Geometry, Source=center_3.Center, Target=divide_curve_7.Points)  # -> Geometry, Transform; disabled
panel_5 = Panel(deconstruct_arc_8.Radius)
digit_scroller_25 = DigitScroller(Scroller_Digits=12, Scroller_Prefix="Digit Scroller", Scroller_Radix=1, Scroller_Value=0.3888888889)
power_13 = Power(A="3", B="-2")
panel_6 = Panel("2/(3*SQRT(3))")
project = Project(Geometry=scale_65.Geometry, Plane=PlaneYZ(0, 0, 0))  # -> Geometry, Transform
rotate_12 = Rotate(Geometry=project.Geometry, Angle=degrees(-90), Plane=PlaneXY(0, 0, 0))  # -> Geometry, Transform
geometry_26 = Geometry(rotate_12.Geometry)
rotate_13 = Rotate(Geometry=geometry_26, Angle=degrees(60), Plane=PlaneXY(0, 0, 0))  # -> Geometry, Transform
move_2 = Move(Geometry=rotate_13.Geometry, Motion=Vector(0.3333333333, 0, 0))  # -> Geometry, Transform
extrude2side = Extrude2Side(Curve=move_2.Geometry, Direction=scale_24.Geometry, Bothside=True, SplitKinkyFaces=False, Bake=False, Cap=False)
brep_wireframe = BrepWireframe(Brep=flatten(extrude2side), Density=4)  # disabled
polar_array_3 = PolarArray(Geometry=extrude2side, Plane=PlaneXY(0, 0, 0), Count=3, Angle=6.283185307)  # -> Geometry, Transform; disabled
plane_trim_planes = PlaneTrimPlanes(Planes=flatten(extrude2side), Plane=xz_plane, Flip=True)  # -> Trimmed, KeptIndicies, Intersected; disabled
boundary_surfaces_6 = BoundarySurfaces(Edges=brep_wireframe)  # disabled
brep_wireframe_2 = BrepWireframe(Brep=polar_array_3.Geometry, Density=1)
deconstruct_brep = DeconstructBrep(Brep=polar_array_3.Geometry)  # -> flatten(Faces), Edges, Vertices
panel_7 = Panel("7/(9*SQRT(3))")
list_item_12 = ListItem(List=divide_curve.Points, Index=0, Wrap=True)

number_slider_9 = Slider(0, range=0..1)
stream_gate_3 = StreamGate(Stream=stream_filter_6, Gate=number_slider_9)  # -> Target0, Target1
shape_data = ShapeData(ShapeGeometry=stream_gate_3.Target1, ID=" ", Hover=False)
stream_filter_7 = StreamFilter(Gate=number_slider_9, Stream0=stream_gate_3.Target0, Stream1=shape_data)

panel_8 = Panel("4/18")
number_slider_10 = Slider(1, range=0..1)
stream_filter_8 = StreamFilter(Gate=number_slider_10, Stream0=merge_9, Stream1=inscribed_polygon_3)
scale_68 = Scale(Geometry=circumscribed_polygon_2, Center=Point(0, 0, 0), Factor=power_13)  # -> Geometry, Transform
railrevolve = RailRevolve(Profile=rotate_12.Geometry, Rail=scale_68.Geometry, Axis=Line((0, 0, 0), (0, 0, 1)), ScaleHeight=True, SplitKFaces=False)
geometry_27 = Geometry(scale_68.Geometry)
brep_wireframe_3 = BrepWireframe(Brep=railrevolve, Density=-1)
merge_19 = Merge(Data1=brep_wireframe_3, Data2=brep_wireframe_2)  # -> flatten(Result)
merge_20 = Merge(Data1=railrevolve, Data2=polar_array_3.Geometry)
brep_join_2 = BrepJoin(Breps=flatten(merge_20))  # -> Breps, Closed; disabled
data_5 = Data(merge_20)
merge_21 = Merge(Data1=true_only_button_9, Data2=data_5, Data3=digit_scroller_22, Data4=divide_curve_9.Points)
loop_start_7 = LoopStart(Repeat=digit_scroller_22, Trigger=merge_21, Data=data_5)  # -> port, Counter, Data; disabled
scale_69 = Scale(Geometry=graft(loop_start_7.Data), Center=discontinuity_3.Points, Factor=0.3333333333)  # -> Geometry, Transform
loop_end_7 = LoopEnd(port=loop_start_7.port, Exit=False, Data=scale_69.Geometry, TimeOutVal=0, pausedState=False, state="Last & Record")  # disabled
merge_22 = Merge(Data1=data_5, Data2=loop_end_7)  # -> flatten(Result); disabled
custom_preview_2 = CustomPreview(
    Geometry=merge_20,
    Material={diffuse=RGB(171, 171, 171), emission=RGB(51, 51, 51), shine=0.5, specular=RGB(255, 255, 255), transparency=0})  # disabled
panel_9 = Panel("7/18")

stream_filter_9 = StreamFilter(Gate=Slider(0, range=0..1), Stream0="3/18", Stream1="6/18")

scale_70 = Scale(Geometry=list_item_12, Center=Point(0, 0, 0), Factor=0.3333333333)  # -> Geometry, Transform
scale_71 = Scale(Geometry=list_item_8, Center=scale_70.Geometry, Factor=0.3333333333)  # -> Geometry, Transform
scale_72 = Scale(Geometry=scale_71.Geometry, Center=scale_70.Geometry, Factor=0.3333333333)  # -> Geometry, Transform
scale_73 = Scale(Geometry=scale_72.Geometry, Center=scale_70.Geometry, Factor=0.3333333333)  # -> Geometry, Transform
power_14 = Power(A="3", B="9")
scale_74 = Scale(Geometry=stream_filter, Center=Point(0, 0, 0), Factor=power_14)  # -> Geometry, Transform
scale_75 = Scale(Geometry=stream_filter_8, Center=Point(0, 0, 0), Factor=power_14)  # -> Geometry, Transform
boundary_surfaces_7 = BoundarySurfaces(Edges=flatten(scale_75.Geometry))
scale_76 = Scale(Geometry=boundary_surfaces_7, Center=Point(0, 0, 0), Factor=expr("1/X", power_14))  # -> Geometry, Transform
custom_preview_3 = CustomPreview(Geometry=flatten(scale_76.Geometry), Material=colour_swatch)  # disabled
scale_77 = Scale(Geometry=stream_filter, Center=Point(0, 0, 0), Factor=power_14)  # -> Geometry, Transform
number_3 = Number(stream_filter_9)
stream_filter_10 = StreamFilter(Gate=0, Stream0="3", Stream1="6")
list_item_13 = ListItem(List=flatten(rotate_12.Geometry), Index=0, Wrap=True)
curve_middle = CurveMiddle(Curve=list_item_13)
number_slider_11 = Slider(1, range=0..3)
scale_78 = Scale(Geometry=list_item_13, Center=curve_middle, Factor=9)  # -> Geometry, Transform
power_15 = Power(A="3", B="6")

number_slider_12 = Slider(0, range=0..1)
stream_gate_4 = StreamGate(Stream=stream_filter_7, Gate=number_slider_12)  # -> Target0, Target1
construct_drawing = ConstructDrawing(
    ShapesGeometry=stream_gate_4.Target1,
    Boundary=rectangle.Rectangle,
    Width=power_15,
    Height=power_15,
    Color=RGBA(255, 255, 255, 0))  # -> Drawing, Boundary
stream_filter_11 = StreamFilter(Gate=number_slider_12, Stream0=stream_gate_4.Target0, Stream1=construct_drawing.Drawing)

evaluate_length = EvaluateLength(Curve=scale_78.Geometry, Length=[0.25, 0.75], Normalized=True)  # -> Point, Tangent, Parameter
drawing_viewer = DrawingViewer(DrawingsShapesGeometry=flatten(stream_filter_11), Resolution=96)  # disabled
subtraction_8 = Subtraction(A="1", B=number_slider)

number_slider_13 = Slider(1, range=0..1)
bounding_rectangle = BoundingRectangle(Content=circle, Plane=PlaneXY(0, 0, 0))
power_16 = Power(A="3", B="6")

stream_filter_12 = StreamFilter(Gate=number_slider_13, Stream1=geometry_2)
stroke = Stroke(ShapeGeometry=stream_filter_12, Color=colour_swatch_2, Weight=0, EndCap=2)
solid_fill_3 = SolidFill(ShapeGeometry=stroke, Color=colour_swatch_2)

power_17 = Power(A="3", B="2")

multiplication_8 = Multiplication(A=power_17, B=3)
division_15 = Division(A=power_17, B=3)

digit_scroller_26 = DigitScroller(Scroller_Digits=12, Scroller_Prefix=" ", Scroller_Radix=11, Scroller_Value=0)
digit_scroller_27 = DigitScroller(Scroller_Digits=12, Scroller_Prefix=" ", Scroller_Radix=11, Scroller_Value=0)

larger_than = LargerThan(FirstNumber=digit_scroller_26, SecondNumber=0)  # -> LargerThan, OrEqualTo
merge_23 = Merge(Data1=true_only_button_4, Data2=digit_scroller_27, Data3=scale_14.Geometry, Data4=digit_scroller_13, Data5=power_17)  # -> flatten(Result)
number_4 = Number(digit_scroller_27)
addition_11 = Addition(A=number_4, B="0")
merge_24 = Merge(Data1=true_only_button_7, Data2=digit_scroller_27, Data3=list_item_5, Data4=power_17, Data5=addition_11)  # -> flatten(Result)
loop_start_8 = LoopStart(Repeat=number_4, Trigger=merge_23, Data=scale_14.Geometry, D1="1", D2=power_17)  # -> port, Counter, Data, Data_2, Data_3
loop_start_9 = LoopStart(Repeat=addition_11, Trigger=merge_24, Data=list_item_5, D1="1", D2=power_17)  # -> port, Counter, Data, Data_2, Data_3
division_16 = Division(A="1", B=loop_start_9.Data_3)
division_17 = Division(A=digit_scroller_13, B=loop_start_8.Data_3)
subtraction_9 = Subtraction(A=loop_start_8.Data_2, B=division_17)
addition_12 = Addition(A=loop_start_8.Data_2, B=division_17)
subtraction_10 = Subtraction(A=loop_start_9.Data_2, B=division_16)
addition_13 = Addition(A=loop_start_9.Data_2, B=division_16)
larger_than_2 = LargerThan(FirstNumber=digit_scroller_26, SecondNumber=0)  # -> LargerThan, OrEqualTo
merge_25 = Merge(Data1=addition_12, Data2=subtraction_9)
scale_79 = Scale(Geometry=graft(loop_start_8.Data), Center=Point(0, 0, 0), Factor=merge_25)  # -> Geometry, Transform
multiplication_9 = Multiplication(A=loop_start_8.Data_3, B=digit_scroller_16)
merge_26 = Merge(Data1=addition_13, Data2=subtraction_10)
larger_than_3 = LargerThan(FirstNumber=number_4, SecondNumber=0)  # -> LargerThan, OrEqualTo
multiplication_10 = Multiplication(A=loop_start_9.Data_3, B=digit_scroller_18)
larger_than_4 = LargerThan(FirstNumber=addition_11, SecondNumber=0)  # -> LargerThan, OrEqualTo
scale_80 = Scale(Geometry=graft(loop_start_9.Data), Center=Point(0, 0, 0), Factor=merge_26)  # -> Geometry, Transform
addition_14 = Addition(A=multiplication_9, B=digit_scroller_16)
subtraction_11 = Subtraction(A=multiplication_9, B=digit_scroller_16)
addition_15 = Addition(A=multiplication_10, B=digit_scroller_18)
merge_27 = Merge(Data1=addition_14, Data2=subtraction_11)  # -> graft(Result)
subtraction_12 = Subtraction(A=multiplication_10, B=digit_scroller_18)
loop_end_8 = LoopEnd(
    port=loop_start_8.port,
    Exit=False,
    Data=scale_79.Geometry,
    Data_2=loop_start_8.Data_2,
    Data_3=merge_27,
    TimeOutVal=0,
    pausedState=False,
    state="Last & Record")  # -> Data, D1, D2
merge_28 = Merge(Data1=addition_15, Data2=subtraction_12)  # -> graft(Result)
loop_end_9 = LoopEnd(
    port=loop_start_9.port,
    Exit=False,
    Data=scale_80.Geometry,
    Data_2=loop_start_9.Data_2,
    Data_3=merge_28,
    TimeOutVal=0,
    pausedState=False,
    state="Last & Record")  # -> Data, D1, D2
merge_29 = Merge(Data1=scale_14.Geometry, Data2=loop_end_8.Data)
merge_30 = Merge(Data1=list_item_5, Data2=loop_end_9.Data)
stream_filter_13 = StreamFilter(Gate=larger_than_4.OrEqualTo, Stream0=list_item_5, Stream1=merge_30)
stream_filter_14 = StreamFilter(Gate=larger_than_3.OrEqualTo, Stream0=scale_14.Geometry, Stream1=merge_29)

scale_81 = Scale(Geometry=stream_filter_14, Center=Point(0, 0, 0), Factor="SQRT(3)/2")  # -> Geometry, Transform

geometry_28 = Geometry(stream_filter_13)
curve_display_8 = CurveDisplay(Curves=geometry_28, Thickness=3, Color=RGB(71, 255, 117))  # disabled
mirror_cut_curve = MirrorCutCurve(
    Curve=stream_filter_13,
    MirrorPlane=yz_plane,
    Reach=0,
    Offset=0,
    Flip=True,
    Join=False,
    Keep=False,
    ConnectionType=0,
    Bulge=0.5)  # -> MirrorCut, SplitIndex, ReachPlane, OffsetPlane, Intersected
geometry_29 = Geometry(stream_filter_14)
geometry_30 = Geometry(scale_81.Geometry)
move_3 = Move(Geometry=mirror_cut_curve.MirrorCut, Motion=vector_xyz_3.Vector)  # -> Geometry, Transform
scale_82 = Scale(Geometry=move_3.Geometry, Center=Point(0, 0, 0), Factor="SQRT(3)/2")  # -> Geometry, Transform
extend_curve = ExtendCurve(Curve=scale_82.Geometry, Type=0, Start=number_3, End=number_3)
join_curves_2 = JoinCurves(Curves=extend_curve, Preserve=False)
polar_array_4 = PolarArray(Geometry=join_curves_2, Plane=PlaneXY(0, 0, 0), Count=stream_filter_10, Angle=3.141592654)  # -> Geometry, Transform
panel_10 = Panel(polar_array_4.Geometry)

merge_31 = Merge(Data1=geometry_29, Data2=polar_array_4.Geometry)

data_6 = Data(merge_31)
merge_32 = Merge(Data1=true_only_button, Data2=data_6, Data3=digit_scroller_26)
loop_start_10 = LoopStart(Repeat=digit_scroller_26, Trigger=merge_32, Data=data_6)  # -> port, Counter, Data
scale_83 = Scale(Geometry=graft(loop_start_10.Data), Center=flatten(merge_5), Factor=0.3333333333)  # -> Geometry, Transform
loop_end_10 = LoopEnd(port=loop_start_10.port, Exit=False, Data=scale_83.Geometry, TimeOutVal=0, pausedState=False, state="Last & Record")  # -> flatten(Data)
merge_33 = Merge(Data1=merge_31, Data2=loop_end_10)
stream_filter_15 = StreamFilter(Gate=larger_than.OrEqualTo, Stream0=data_6, Stream1=merge_33)

geometry_31 = Geometry(stream_filter_15)

curve_display_9 = CurveDisplay(Curves=geometry_31, Thickness=1, Color=RGB(0, 244, 124))  # disabled
stream_filter_16 = StreamFilter(Gate=larger_than_2.OrEqualTo, Stream0=merge_31, Stream1=geometry_31)

geometry_32 = Geometry(flatten(stream_filter_16))
stream_gate_5 = StreamGate(Stream=geometry_32, Gate=number_slider)  # -> Target0, Target1
geometry_33 = Geometry(flatten(stream_filter_16))
trim_with_brep = TrimWithBrep(Curve=stream_gate_5.Target0, Brep=cap_holes)  # -> Inside, Outside
geometry_34 = Geometry(flatten(trim_with_brep.Inside))
stream_filter_17 = StreamFilter(Gate=number_slider, Stream0=geometry_34, Stream1=geometry_33)
shape_in_brep = ShapeInBrep(Brep=cap_holes, Shape=stream_filter_17)  # disabled
scale_84 = Scale(Geometry=flatten(stream_filter_17), Center=Point(0, 0, 0), Factor=power_5)  # -> Geometry, Transform
point_in_curves = PointInCurves(Point=flatten(scale_50.Geometry), Curves=flatten(scale_84.Geometry))  # -> Relationship, Index, Point; disabled
scale_85 = Scale(Geometry=stream_filter_17, Center=Point(0, 0, 0), Factor=power_14)  # -> Geometry, Transform
equality = Equality(FirstNumber=point_in_curves.Relationship, SecondNumber=1)  # -> Equality, Inequality
curve_display_10 = CurveDisplay(Curves=stream_filter_17, Thickness=2, Color=RGB(102, 102, 102))  # disabled

number_slider_14 = Slider(1, range=0..1)

stream_gate_6 = StreamGate(Stream=geometry_17, Gate=number_slider_14)  # -> Target0, Target1
scale_86 = Scale(Geometry=stream_gate_6.Target1, Center=Point(0, 0, 0), Factor=power_14)  # -> Geometry, Transform
collision_one_many_6 = CollisionOneMany(Collider=flatten(scale_86.Geometry), Obstacles=flatten(scale_85.Geometry))  # -> Collision, Index
cull_pattern_6 = CullPattern(List=flatten(geometry_17), CullPattern=collision_one_many_6.Collision)

stream_filter_18 = StreamFilter(Gate=number_slider_14, Stream0=stream_gate_6.Target0, Stream1=cull_pattern_6)

stream_gate_7 = StreamGate(Stream=stream_filter_18, Gate=number_slider_10)  # -> Target0, Target1
deconstruct_arc_10 = DeconstructArc(Arc=stream_gate_7.Target1)  # -> BasePlane, Radius, Angle
rotate_14 = Rotate(Geometry=deconstruct_arc_10.BasePlane, Angle=degrees(90), Plane=deconstruct_arc_10.BasePlane)  # -> Geometry, Transform
inscribed_polygon_5 = InscribedPolygon(Plane=rotate_14.Geometry, Radius=deconstruct_arc_10.Radius, Sides=number_slider_7)
merge_34 = Merge(Data1=inscribed_polygon_4, Data2=inscribed_polygon_5)
merge_35 = Merge(Data1=geometry_22, Data2=stream_gate_7.Target0)
stream_filter_19 = StreamFilter(Gate=number_slider_10, Stream0=merge_35, Stream1=merge_34)
mirror_cut_curve_2 = MirrorCutCurve(
    Curve=stream_filter_19,
    MirrorPlane=rotate_8.Geometry,
    Reach=0,
    Offset=0,
    Flip=True,
    Join=True,
    Keep=True,
    ConnectionType=0,
    Bulge=0.5)  # -> MirrorCut, SplitIndex, ReachPlane, OffsetPlane, Intersected; disabled
curve_display_11 = CurveDisplay(Curves=stream_filter_19, Thickness=2)  # disabled
join_curves_3 = JoinCurves(Curves=flatten(mirror_cut_curve_2.MirrorCut), Preserve=False)

stream_filter_20 = StreamFilter(Gate=0, Stream0=stream_filter_19, Stream1=join_curves_3)

stream_gate_8 = StreamGate(Stream=flatten(stream_filter_20), Gate=number_slider_11)  # -> Target0, Target1, Target2, Target3
scale_87 = Scale(Geometry=stream_gate_8.Target1, Center=Point(0, 0, 0), Factor=power_14)  # -> Geometry, Transform
collision_many_many_2 = CollisionManyMany(Colliders=stream_gate_8.Target2)  # -> Collision, Indices
boundary_surfaces_8 = BoundarySurfaces(Edges=stream_gate_8.Target3)
collision_many_many_3 = CollisionManyMany(Colliders=boundary_surfaces_8)  # -> Collision, Indices

boundary_surfaces_9 = BoundarySurfaces(Edges=scale_87.Geometry)

cull_pattern_7 = CullPattern(List=stream_gate_8.Target2, CullPattern=invert(collision_many_many_2.Collision))
cull_pattern_8 = CullPattern(List=stream_gate_8.Target2, CullPattern=collision_many_many_2.Collision)
cull_pattern_9 = CullPattern(List=boundary_surfaces_8, CullPattern=invert(collision_many_many_3.Collision))
cull_pattern_10 = CullPattern(List=boundary_surfaces_8, CullPattern=collision_many_many_3.Collision)
scale_88 = Scale(Geometry=boundary_surfaces_9, Center=Point(0, 0, 0), Factor=expr("1/X", power_14))  # -> Geometry, Transform
solid_union_2 = SolidUnion(Breps=cull_pattern_8)
merge_36 = Merge(Data1=cull_pattern_7, Data2=solid_union_2)
solid_union_3 = SolidUnion(Breps=cull_pattern_10)
merge_37 = Merge(Data1=cull_pattern_9, Data2=solid_union_3)
stream_filter_21 = StreamFilter(Gate=number_slider_11, Stream0=stream_gate_8.Target0, Stream1=scale_88.Geometry, Stream2=merge_36, Stream3=merge_37)

curve_display_12 = CurveDisplay(Curves=geometry_31, Thickness=1, Color=colour_swatch_3)  # disabled

number_slider_15 = Slider(1, range=0..1)
number_slider_16 = Slider(1, range=0..1)

stream_gate_9 = StreamGate(Stream=scale_76.Geometry, Gate=number_slider_16)  # -> Target0, Target1
scale_89 = Scale(Geometry=stream_gate_9.Target1, Center=Point(0, 0, 0), Factor=power_14)  # -> Geometry, Transform
surface_split = SurfaceSplit(Surface=scale_89.Geometry, Curves=scale_74.Geometry)
list_item_14 = ListItem(List=surface_split, Index=0, Wrap=True)
scale_90 = Scale(Geometry=list_item_14, Center=Point(0, 0, 0), Factor=expr("1/X", power_14))  # -> Geometry, Transform
stream_filter_22 = StreamFilter(Gate=number_slider_16, Stream0=stream_gate_9.Target0, Stream1=scale_90.Geometry)
stream_gate_10 = StreamGate(Stream=stream_filter_22, Gate=number_slider_15)  # -> Target0, Target1
polar_array_5 = PolarArray(Geometry=stream_gate_10.Target1, Plane=PlaneXY(0, 0, 0), Count=6, Angle=6.283185307)  # -> Geometry, Transform
stream_filter_23 = StreamFilter(Gate=number_slider_15, Stream0=stream_gate_10.Target0, Stream1=polar_array_5.Geometry)
stream_filter_24 = StreamFilter(Gate=number_slider_13, Stream1=stream_filter_23)  # -> flatten(Stream)
stroke_2 = Stroke(ShapeGeometry=stream_filter_24, Color=colour_swatch, Weight=0, EndCap=2)  # disabled
solid_fill_4 = SolidFill(ShapeGeometry=flatten(stream_filter_24), Color=colour_swatch)  # disabled
stream_gate_11 = StreamGate(Stream=stream_filter_21, Gate=number_slider_16)  # -> Target0, Target1
scale_91 = Scale(Geometry=stream_gate_11.Target1, Center=Point(0, 0, 0), Factor=power_14)  # -> Geometry, Transform
surface_split_2 = SurfaceSplit(Surface=scale_91.Geometry, Curves=scale_77.Geometry)
list_item_15 = ListItem(List=surface_split_2, Index=0, Wrap=True)
scale_92 = Scale(Geometry=list_item_15, Center=Point(0, 0, 0), Factor=expr("1/X", power_14))  # -> Geometry, Transform

stream_filter_25 = StreamFilter(Gate=number_slider_16, Stream0=stream_gate_11.Target0, Stream1=scale_92.Geometry)

stream_gate_12 = StreamGate(Stream=stream_filter_25, Gate=number_slider_15)  # -> Target0, Target1
polar_array_6 = PolarArray(Geometry=stream_gate_12.Target1, Plane=PlaneXY(0, 0, 0), Count=6, Angle=6.283185307)  # -> Geometry, Transform
stream_filter_26 = StreamFilter(Gate=number_slider_15, Stream0=stream_gate_12.Target0, Stream1=polar_array_6.Geometry)

merge_38 = Merge(Data1=stream_filter_26)
curve_display_13 = CurveDisplay(Curves=merge_38, Thickness=2, Color=RGB(0, 244, 124))  # disabled
custom_preview_4 = CustomPreview(Geometry=merge_38, Material=colour_swatch_3)

stream_filter_27 = StreamFilter(Gate=number_slider_13, Stream1=merge_38)  # -> flatten(Stream)
stroke_3 = Stroke(ShapeGeometry=stream_filter_27, Color=colour_swatch_3, Weight=0, EndCap=2)  # disabled
solid_fill_5 = SolidFill(ShapeGeometry=flatten(stream_filter_27), Color=colour_swatch_3)
merge_39 = Merge(Data1=flatten(solid_fill_3), Data2=flatten(stream_filter_24), Data3=flatten(solid_fill_5))
clean_tree = CleanTree(RemoveNulls=True, RemoveInvalid=True, RemoveEmpty=True, Tree=merge_39)
shape_data_2 = ShapeData(ShapeGeometry=clean_tree, ID=" ", Hover=False)

construct_drawing_2 = ConstructDrawing(
    ShapesGeometry=flatten(shape_data_2),
    Boundary=bounding_rectangle,
    Width=power_16,
    Height=power_16,
    Color=RGBA(255, 255, 255, 0))  # -> Drawing, Boundary
drawing_viewer_2 = DrawingViewer(DrawingsShapesGeometry=construct_drawing_2.Drawing, Resolution=96)  # disabled

save_svg = SaveSvg(DrawingsShapesGeometry=construct_drawing_2.Drawing, FolderPath="C:\", FileName="ϱvƨ.", Save=Toggle(True))
