# Grasshopper definition XHꓨ. 𓇬◦୦◦◯◦୦◦⎈ꙮ⎈◦୦◦◯◦୦◦𓇬 𓇬◦୦◦◯◦୦◦⎈ꙮ⎈◦୦◦◯◦୦◦𓇬 .GHX (Grasshopper 1.0.7)
# plug-ins: CurvePlus, Anemone, Pancake, GhPython Script, GraphicPlus, BubalusGH2.0, Heteroptera, Bulge, Kangaroo2 Components, Weaverbird, BullAnt, Pufferfish, Flexibility.Gh-by Ehsan, BlueOrange

series = Series(Start=1, Step=1, Count=Slider(4, range=0..8))

line_sdl = LineSDL(Location=Point(0, 0, 0), Direction=Vector(0, 1, 0), StartLength=0.5, EndLength=0.5)
polar_array = PolarArray(Geometry=line_sdl, Plane=PlaneXY(0, 0, 0), Count=3, Angle=6.283185307)  # -> Geometry, Transform
point = Point(Point(0, 0, 0))
digit_scroller = DigitScroller(Scroller_Digits=12, Scroller_Prefix="Digit Scroller", Scroller_Radix=11, Scroller_Value=3)
true_only_button = TrueOnlyButton(LastSaveLocalization="neutral,N")
true_only_button_2 = TrueOnlyButton(LastSaveLocalization="neutral,N")
merge = Merge(Data1=true_only_button_2, Data2=digit_scroller)
point_2 = Point(Point(0, 0, 0))
number = Number(graft(series))
digit_scroller_2 = DigitScroller(Scroller_Digits=12, Scroller_Prefix="Digit Scroller", Scroller_Radix=11, Scroller_Value=2)
negative = Negative(Value=number)
subtraction = Subtraction(A=negative, B="1")
power = Power(A="3", B=negative)
power_2 = Power(A="3", B=subtraction)
colour_swatch = ColourSwatch(SwatchColor=RGBA(255, 255, 255, 0))
digit_scroller_3 = DigitScroller(Scroller_Digits=12, Scroller_Prefix="Digit Scroller", Scroller_Radix=1, Scroller_Value=0.4553415)
colour_swatch_2 = ColourSwatch(SwatchColor=RGB(245, 245, 245))
digit_scroller_4 = DigitScroller(Scroller_Digits=12, Scroller_Prefix="Digit Scroller", Scroller_Radix=1, Scroller_Value=1)
circumscribed_polygon = CircumscribedPolygon(Plane=PlaneXY(0, 0, 0), Radius="1/6*(1+SQRT(3))", Sides=6)
digit_scroller_5 = DigitScroller(Scroller_Digits=12, Scroller_Prefix="Digit Scroller", Scroller_Radix=1, Scroller_Value=1)
digit_scroller_6 = DigitScroller(Scroller_Digits=12, Scroller_Prefix="Digit Scroller", Scroller_Radix=1, Scroller_Value=0.921120864)
scale = Scale(Geometry=circumscribed_polygon, Center=Point(0, 0, 0), Factor=digit_scroller_6)  # -> Geometry, Transform
boundary_surfaces = BoundarySurfaces(Edges=scale.Geometry)
number_slider = Slider(3, range=0..10)
plane = Plane(PlaneXY(0, 0, 0))
rotate = Rotate(Geometry=plane, Angle=degrees(30), Plane=PlaneXY(0, 0, 0))  # -> Geometry, Transform
plane_2 = Plane(PlaneXY(0, 0, 0))
rotate_2 = Rotate(Geometry=plane_2, Angle=degrees(30), Plane=PlaneXY(0, 0, 0))  # -> Geometry, Transform
digit_scroller_7 = DigitScroller(Scroller_Digits=12, Scroller_Prefix="Digit Scroller", Scroller_Radix=11, Scroller_Value=1)
digit_scroller_8 = DigitScroller(Scroller_Digits=12, Scroller_Prefix="Digit Scroller", Scroller_Radix=11, Scroller_Value=2)
division = Division(A=Slider(1, range=0..1), B=2)
circumscribed_polygon_2 = CircumscribedPolygon(Plane=PlaneXY(0, 0, 0), Radius=division, Sides=6)
circle = Circle(Plane=PlaneXY(0, 0, 0), Radius=division)
geometry = Geometry(circle)
stroke = Stroke(ShapeGeometry=geometry, Color=colour_swatch, Weight=0, EndCap=2)
solid_fill = SolidFill(ShapeGeometry=stroke, Color=colour_swatch)
scale_2 = Scale(Geometry=circle, Center=Point(0, 0, 0), Factor=digit_scroller_5)  # -> Geometry, Transform
division_2 = Division(A=Slider(1, range=0..1), B=2)
expression = Expression(O=division_2, Expression="O*(SQRT(3)/2)")
expression_2 = Expression(O=division_2, Expression="O/(SQRT(3)/2)")
inscribed_polygon = InscribedPolygon(Plane=PlaneXY(0, 0, 0), Radius=expression_2, Sides=6)
tri_fan_polyline = TriFanPolyline(Polyline=inscribed_polygon)

subtraction_2 = Subtraction(A=number, B="0")
scale_3 = Scale(Geometry=tri_fan_polyline, Center=Point(0, 0, 0), Factor=3)  # -> Geometry, Transform

power_3 = Power(A="3", B=subtraction_2)
weaverbird_s_split_triangles_subdivision = WeaverbirdsSplitTrianglesSubdivision(MeshCurves=scale_3.Geometry, Level=graft(power_3))  # -> simplify(OutputMeshCurves)
weaverbird_s_vertices_component = WeaverbirdsVerticesComponent(MeshClosedPolylinesGroup=weaverbird_s_split_triangles_subdivision, Weld=True)
face_normals = FaceNormals(Mesh=weaverbird_s_split_triangles_subdivision)  # -> Centers, Normals
weave = Weave(Pattern=[0, 1], Stream0=face_normals.Centers, Stream1=weaverbird_s_vertices_component, NullGaps=False)
circumscribed_polygon_3 = CircumscribedPolygon(Plane=PlaneXY(0, 0, 0), Radius=expression_2, Sides=6)
scale_4 = Scale(Geometry=circumscribed_polygon_3, Center=Point(0, 0, 0), Factor=0.5)  # -> Geometry, Transform
geometry_2 = Geometry(scale_4.Geometry)
tri_fan_polyline_2 = TriFanPolyline(Polyline=scale_4.Geometry)
weaverbird_s_mesh_edges = WeaverbirdsMeshEdges(MeshOrPolylines=tri_fan_polyline_2)
pipe = Pipe(Curve=weaverbird_s_mesh_edges, Radius=power_2, Caps=0)  # -> flatten(Pipe); disabled
circle_2 = Circle(Plane=PlaneXY(0, 0, 0), Radius=division_2)
curve_display = CurveDisplay(Curves=circle_2, Thickness=1, Color=RGB(255, 0, 0))
loop_start = LoopStart(Repeat=digit_scroller, Trigger=merge, Data=circle_2)  # -> port, Counter, Data
geometry_3 = Geometry(graft(circle_2))
scale_5 = Scale(Geometry=geometry_3, Center=Point(0, 0, 0), Factor=power)  # -> Geometry, Transform
area = Area(Geometry=scale_5.Geometry)  # -> Area, Centroid
orient = Orient(Geometry=scale_5.Geometry, Source=area.Centroid, Target=weave)  # -> Geometry, Transform
rotate_3 = Rotate(Geometry=circle_2, Angle=1.570796327, Plane=PlaneXY(0, 0, 0))  # -> Geometry, Transform
geometry_4 = Geometry(orient.Geometry)
deconstruct_arc = DeconstructArc(Arc=geometry_4)  # -> BasePlane, Radius, Angle
scale_6 = Scale(Geometry=geometry_4, Center=deconstruct_arc.BasePlane, Factor=0.3333333333)  # -> Geometry, Transform
divide_curve = DivideCurve(Curve=rotate_3.Geometry, Count=6, Kinks=False)  # -> Points, Tangents, Parameters
scale_7 = Scale(Geometry=divide_curve.Points, Center=Point(0, 0, 0), Factor=0.75)  # -> Geometry, Transform
scale_8 = Scale(Geometry=graft(circle_2), Center=flatten(scale_7.Geometry), Factor=0.1111111111)  # -> Geometry, Transform
scale_9 = Scale(Geometry=divide_curve.Points, Center=Point(0, 0, 0), Factor=1)  # -> Geometry, Transform
scale_10 = Scale(Geometry=divide_curve.Points, Center=Point(0, 0, 0), Factor=0.75)  # -> Geometry, Transform
scale_11 = Scale(Geometry=graft(scale_8.Geometry), Center=flatten(scale_10.Geometry), Factor=0.1111111111)  # -> Geometry, Transform
merge_2 = Merge(Data1=scale_9.Geometry, Data2=point_2)
scale_12 = Scale(Geometry=graft(loop_start.Data), Center=flatten(merge_2), Factor=0.3333333333)  # -> Geometry, Transform
scale_13 = Scale(Geometry=divide_curve.Points, Center=Point(0, 0, 0), Factor=0.75)  # -> Geometry, Transform
scale_14 = Scale(Geometry=graft(scale_11.Geometry), Center=flatten(scale_13.Geometry), Factor=0.1111111111)  # -> Geometry, Transform
loop_end = LoopEnd(port=loop_start.port, Exit=False, Data=scale_12.Geometry, TimeOutVal=0, pausedState=False, state="Last & Record")
geometry_5 = Geometry(loop_end)
curve_display_2 = CurveDisplay(Curves=geometry_5, Thickness=1)
geometry_6 = Geometry(scale_6.Geometry)
boundary_surfaces_2 = BoundarySurfaces(Edges=geometry_6)  # disabled
area_2 = Area(Geometry=geometry_6)  # -> Area, Centroid
deconstruct_arc_2 = DeconstructArc(Arc=geometry_6)  # -> BasePlane, flatten(Radius), Angle
expression_3 = Expression(O=digit_scroller_7, Expression="6*3^O")
inscribed_polygon_2 = InscribedPolygon(Plane=rotate.Geometry, Radius=division, Sides=6)
geometry_7 = Geometry(inscribed_polygon_2)
scale_15 = Scale(Geometry=geometry_7, Center=Point(0, 0, 0), Factor=digit_scroller_4)  # -> Geometry, Transform
boundary_surfaces_3 = BoundarySurfaces(Edges=scale_15.Geometry)
collision_one_many = CollisionOneMany(Collider=area_2.Centroid, Obstacles=boundary_surfaces_3)  # -> Collision, Index
cull_pattern = CullPattern(List=geometry_6, CullPattern=collision_one_many.Collision)
curve_display_3 = CurveDisplay(Curves=cull_pattern, Thickness=1, Color=colour_swatch_2)
scale_16 = Scale(Geometry=circumscribed_polygon_2, Center=Point(0, 0, 0), Factor=0.6666666667)  # -> Geometry, Transform
list_item = ListItem(List=scale_16.Geometry, Index=5, Wrap=True)
circumscribed_polygon_4 = CircumscribedPolygon(Plane=rotate_2.Geometry, Radius=division, Sides=6)
collision_one_many_2 = CollisionOneMany(Collider=cull_pattern, Obstacles=scale_15.Geometry)  # -> Collision, Index

cull_pattern_2 = CullPattern(List=cull_pattern, CullPattern=invert(collision_one_many_2.Collision))

tri_fan_polyline_3 = TriFanPolyline(Polyline=circumscribed_polygon_4)
expression_4 = Expression(I=digit_scroller_8, Expression="(3^I)/(4+(9/2)*(3^(I-1)-1))")
addition = Addition(A=digit_scroller_8, B=1)
collision_one_many_3 = CollisionOneMany(Collider=cull_pattern, Obstacles=weaverbird_s_mesh_edges)  # -> Collision, Index; disabled
tri_fan_polyline_4 = TriFanPolyline(Polyline=circumscribed_polygon_2)
simple_mesh = SimpleMesh(Brep=tri_fan_polyline_4)
number_slider_2 = Slider(1, range=0..1)
digit_scroller_9 = DigitScroller(Scroller_Digits=12, Scroller_Prefix="Digit Scroller", Scroller_Radix=11, Scroller_Value=0)

scale_17 = Scale(Geometry=list_item, Center=Point(0, 0, 0), Factor="SQRT(3)/2")  # -> Geometry, Transform

number_slider_3 = Slider(0, range=0..2)
stream_gate = StreamGate(Stream=cull_pattern_2, Gate=number_slider_3)  # -> Target0, Target1, Target2
boundary_surfaces_4 = BoundarySurfaces(Edges=flatten(stream_gate.Target1))
boundary_surfaces_5 = BoundarySurfaces(Edges=stream_gate.Target2)
number_slider_4 = Slider(3, range=0..10)
divide_curve_2 = DivideCurve(Curve=geometry_2, Count=expression_3, Kinks=False)  # -> Points, Tangents, Parameters
power_4 = Power(A="2", B="8")
collision_many_many = CollisionManyMany(Colliders=boundary_surfaces_5)  # -> Collision, Indices
scale_18 = Scale(Geometry=circle, Center=Point(0, 0, 0), Factor=0.3333333333)  # -> Geometry, Transform
merge_3 = Merge(Data1=scale_18.Geometry, Data2=cull_pattern)

boundary_surfaces_6 = BoundarySurfaces(Edges=flatten(merge_3))  # disabled
geometry_8 = Geometry([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])

custom_preview = CustomPreview(Geometry=geometry_8, Material=colour_swatch_2)
stroke_2 = Stroke(ShapeGeometry=geometry_8, Color=colour_swatch_2, Weight=0, EndCap=2)
solid_fill_2 = SolidFill(ShapeGeometry=stroke_2, Color=colour_swatch_2)
scale_19 = Scale(Geometry=circumscribed_polygon_2, Center=Point(0, 0, 0), Factor=0.3333333333)  # -> Geometry, Transform
scale_20 = Scale(Geometry=circle, Center=Point(0, 0, 0), Factor=0.6666666667)  # -> Geometry, Transform
panel = Panel("3/4")
construct_domain = ConstructDomain(DomainStart=expr("-X", division_2), DomainEnd=division_2)
rectangle = Rectangle(Plane=PlaneXY(0, 0, 0), XSize=construct_domain, YSize=construct_domain, Radius=0)  # -> Rectangle, Length
divide_curve_3 = DivideCurve(Curve=rectangle.Rectangle, Count=8, Kinks=False)  # -> Points, Tangents, Parameters
negative_2 = Negative(Value=addition)
true_only_button_3 = TrueOnlyButton(LastSaveLocalization="neutral,N")
scale_21 = Scale(Geometry=inscribed_polygon_2, Center=Point(0, 0, 0), Factor=0.3333333333)  # -> Geometry, Transform
cull_pattern_3 = CullPattern(List=cull_pattern, CullPattern=collision_one_many_3.Collision)
scale_22 = Scale(Geometry=inscribed_polygon_2, Center=Point(0, 0, 0), Factor=0.6666666667)  # -> Geometry, Transform
digit_scroller_10 = DigitScroller(Scroller_Digits=12, Scroller_Prefix="Digit Scroller", Scroller_Radix=1, Scroller_Value=0.1005000001)
division_3 = Division(A="10", B="9")
scale_23 = Scale(Geometry=geometry_2, Center=Point(0, 0, 0), Factor=division_3)  # -> Geometry, Transform
line = Line(Line((0, 0.1666666667, 0), (0, 0.5, 0)))
merge_4 = Merge(Data1=true_only_button_3, Data2=digit_scroller_9)
loop_start_2 = LoopStart(Repeat=digit_scroller_9, Trigger=merge_4, Data=circle_2)  # -> port, Counter, Data
mesh_join = MeshJoin(Meshes=simple_mesh)
mesh_edges = MeshEdges(Mesh=mesh_join)  # -> NakedEdges, InteriorEdges, NonManifoldEdges
scale_24 = Scale(Geometry=mesh_edges.InteriorEdges, Center=Point(0, 0, 0), Factor=2)  # -> Geometry, Transform
join_curves = JoinCurves(Curves=scale_24.Geometry, Preserve=False)
power_5 = Power(A="2", B="-16")
scale_25 = Scale(Geometry=circle_2, Center=Point(0, 0, 0), Factor=1)  # -> Geometry, Transform
scale_26 = Scale(Geometry=scale_25.Geometry, Center=Point(0, 0, 0), Factor=1)  # -> Geometry, Transform
power_6 = Power(A="3", B=negative_2)
list_item_2 = ListItem(List=join_curves, Index=1, Wrap=True)
vector = Vector(list_item_2)
scale_27 = Scale(Geometry=vector, Center=Point(0, 0, 0), Factor="2/SQRT(3)")  # -> Geometry, Transform
multiplication = Multiplication(A=list_item_2, B=2)
cull_pattern_4 = CullPattern(List=boundary_surfaces_5, CullPattern=invert(collision_many_many.Collision))
multiplication_2 = Multiplication(A="36", B="1.6666666666666666")
cull_pattern_5 = CullPattern(List=boundary_surfaces_5, CullPattern=collision_many_many.Collision)
curve_display_4 = CurveDisplay(Curves=cull_pattern_3, Thickness=2, Color=RGB(0, 0, 255))
panel_2 = Panel("""3/4
9/13
27/40
81/121""")
list_item_3 = ListItem(List=scale_16.Geometry, Index=5, Wrap=True)
explode = Explode(Curve=list_item_3, Recursive=True)  # -> Segments, Vertices
division_4 = Division(A="8", B="9")
scale_28 = Scale(Geometry=geometry_2, Center=Point(0, 0, 0), Factor=division_4)  # -> Geometry, Transform
deconstruct_arc_3 = DeconstructArc(Arc=cull_pattern_3)  # -> BasePlane, Radius, Angle
list_item_4 = ListItem(List=explode.Segments, Index=5, Wrap=True)
xz_plane = XZPlane(Origin=Point(0, 0, 0))
geometry_9 = Geometry(polar_array.Geometry)
digit_scroller_11 = DigitScroller(Scroller_Digits=12, Scroller_Prefix="Digit Scroller", Scroller_Radix=1, Scroller_Value=0.6694214876)
divide_curve_4 = DivideCurve(Curve=scale_23.Geometry, Count=multiplication_2, Kinks=False)  # -> Points, Tangents, Parameters
scale_29 = Scale(Geometry=divide_curve.Points, Center=Point(0, 0, 0), Factor=expression_4)  # -> Geometry, Transform
min_max = MinMax(Number=deconstruct_arc_3.Radius)  # -> Minimum, Maximum
divide_curve_5 = DivideCurve(Curve=line, Count=expr("X/1", expression_3), Kinks=False)  # -> Points, Tangents, Parameters
data = Data(scale_18.Geometry)
divide_curve_6 = DivideCurve(Curve=scale_16.Geometry, Count=12, Kinks=False)  # -> Points, Tangents, Parameters
discontinuity = Discontinuity(Curve=inscribed_polygon_2, Level=1)  # -> Points, Parameters
merge_5 = Merge(Data1=point, Data2=discontinuity.Points)  # -> flatten(Result)
scale_30 = Scale(Geometry=discontinuity.Points, Center=Point(0, 0, 0), Factor=1.333333333)  # -> Geometry, Transform
scale_31 = Scale(Geometry=graft(circle), Center=discontinuity.Points, Factor=0.3333333333)  # -> Geometry, Transform
scale_32 = Scale(Geometry=graft(scale_31.Geometry), Center=discontinuity.Points, Factor=0.3333333333)  # -> Geometry, Transform
curve_display_5 = CurveDisplay(Curves=[scale_31.Geometry, circle, scale_32.Geometry], Thickness=1, Color=RGB(0, 221, 255))
tri_fan_polyline_5 = TriFanPolyline(Polyline=scale_22.Geometry)
true_only_button_4 = TrueOnlyButton(LastSaveLocalization="neutral,N")
multiplication_3 = Multiplication(A="36", B="1.3333333333333333")
digit_scroller_12 = DigitScroller(Scroller_Digits=12, Scroller_Prefix="Digit Scroller", Scroller_Radix=11, Scroller_Value=3)
merge_6 = Merge(Data1=true_only_button_4, Data2=data, Data3=digit_scroller_12)
cull_nth_plus = CullNthPlus(List=divide_curve_5.Points, CullFrequency=2)  # -> RemainList, RemoveList; disabled
panel_3 = Panel(deconstruct_arc_2.Radius)
scale_33 = Scale(Geometry=graft(loop_start_2.Data), Center=flatten(scale_29.Geometry), Factor=power_6)  # -> Geometry, Transform
geometry_10 = Geometry(mesh_edges.InteriorEdges)
solid_union = SolidUnion(Breps=cull_pattern_5)
merge_7 = Merge(Data1=cull_pattern_4, Data2=solid_union)
stream_filter = StreamFilter(Gate=number_slider_3, Stream0=stream_gate.Target0, Stream1=boundary_surfaces_4, Stream2=merge_7)
proximity_3d = Proximity3D(Points=deconstruct_arc_3.BasePlane, Group=65536, MaxRadius=expr("X*3", min_max.Maximum))  # -> flatten(Links), Topology; disabled
true_only_button_5 = TrueOnlyButton(LastSaveLocalization="neutral,N")
divide_curve_7 = DivideCurve(Curve=scale_28.Geometry, Count=multiplication_3, Kinks=False)  # -> Points, Tangents, Parameters
scale_34 = Scale(Geometry=divide_curve_3.Points, Center=Point(0, 0, 0), Factor=0.75)  # -> Geometry, Transform
list_item_5 = ListItem(List=discontinuity.Points, Index=[1, 4], Wrap=True)
division_5 = Division(A="1", B=number_slider_4)
addition_2 = Addition(A=number_slider_2, B=division_5)
scale_35 = Scale(Geometry=scale_16.Geometry, Center=Point(0, 0, 0), Factor=addition_2)  # -> Geometry, Transform
geometry_11 = Geometry(cull_nth_plus.RemoveList)
digit_scroller_13 = DigitScroller(Scroller_Digits=12, Scroller_Prefix="Digit Scroller", Scroller_Radix=1, Scroller_Value=1)
subtraction_3 = Subtraction(A=number_slider_2, B=division_5)
scale_36 = Scale(Geometry=scale_16.Geometry, Center=Point(0, 0, 0), Factor=subtraction_3)  # -> Geometry, Transform
digit_scroller_14 = DigitScroller(Scroller_Digits=12, Scroller_Prefix="Digit Scroller", Scroller_Radix=11, Scroller_Value=2)
loop_start_3 = LoopStart(Repeat=digit_scroller_12, Trigger=merge_6, Data=data)  # -> port, Counter, Data
fast_loop_start = FastLoopStart(Iterations=4, Data=circle_2)  # -> port, Counter, Data
true_only_button_6 = TrueOnlyButton(LastSaveLocalization="neutral,N")
loop_end_2 = LoopEnd(port=loop_start_2.port, Exit=False, Data=scale_33.Geometry, TimeOutVal=0, pausedState=False, state="Output last")
scale_37 = Scale(Geometry=graft(loop_start_3.Data), Center=discontinuity.Points, Factor=0.3333333333)  # -> Geometry, Transform
dotdisplay = DotDisplay(Point=geometry_11)
tri_fan_polyline_6 = TriFanPolyline(Polyline=scale_22.Geometry)
merge_8 = Merge(Data1=true_only_button_6, Data2=digit_scroller_14)
loop_start_4 = LoopStart(Repeat=digit_scroller_14, Trigger=merge_8, Data=circle_2)  # -> port, Counter, Data
digit_scroller_15 = DigitScroller(Scroller_Digits=12, Scroller_Prefix="Digit Scroller", Scroller_Radix=11, Scroller_Value=4)
list_item_6 = ListItem(List=list_item_5, Index=0, Wrap=True)
power_7 = Power(A="3", B="1")
weaverbird_s_split_triangles_subdivision_2 = WeaverbirdsSplitTrianglesSubdivision(MeshCurves=tri_fan_polyline_6, Level=power_7)
number_slider_5 = Slider(1, range=0..1)
tri_fan_polyline_7 = TriFanPolyline(Polyline=scale_22.Geometry)
power_8 = Power(A="3", B="1")
weaverbird_s_split_triangles_subdivision_3 = WeaverbirdsSplitTrianglesSubdivision(MeshCurves=tri_fan_polyline_5, Level=power_8)
face_boundaries = FaceBoundaries(Mesh=weaverbird_s_split_triangles_subdivision_3)
scale_38 = Scale(Geometry=graft(data), Center=list_item_6, Factor=0.3333333333)  # -> Geometry, Transform
true_only_button_7 = TrueOnlyButton(LastSaveLocalization="neutral,N")
end_points = EndPoints(Curve=proximity_3d.Links)  # -> Start, End
geometry_12 = Geometry(loop_end_2)
list_item_7 = ListItem(List=loop_end_2, Index=0, Wrap=True)
center = Center(Geometry=flatten(list_item_7), forall=True)  # -> Center, Dimension
scale_39 = Scale(Geometry=list_item_7, Center=center.Center, Factor=0.3333333333)  # -> Geometry, Transform
scale_40 = Scale(Geometry=list_item_7, Center=center.Center, Factor=0.3333333333)  # -> Geometry, Transform
scale_41 = Scale(Geometry=graft(loop_start_4.Data), Center=flatten(scale_34.Geometry), Factor=0.1111111111)  # -> Geometry, Transform
multiplication_4 = Multiplication(A=number_slider_4, B=3)
addition_3 = Addition(A=multiplication_4, B=3)
power_9 = Power(A="3", B="1")
weaverbird_s_split_triangles_subdivision_4 = WeaverbirdsSplitTrianglesSubdivision(MeshCurves=tri_fan_polyline_7, Level=power_9)
subtraction_4 = Subtraction(A=multiplication_4, B="3")
division_6 = Division(A="1", B=subtraction_4)
subtraction_5 = Subtraction(A=number_slider_2, B=division_6)
scale_42 = Scale(Geometry=scale_36.Geometry, Center=Point(0, 0, 0), Factor=subtraction_5)  # -> Geometry, Transform
division_7 = Division(A="1", B=addition_3)
addition_4 = Addition(A=number_slider_2, B=division_7)
scale_43 = Scale(Geometry=scale_35.Geometry, Center=Point(0, 0, 0), Factor=addition_4)  # -> Geometry, Transform
face_boundaries_2 = FaceBoundaries(Mesh=weaverbird_s_split_triangles_subdivision_2)
point_3 = Point(Point(0, 0, 0))
rotate_4 = Rotate(Geometry=circle, Angle=1.570796327, Plane=PlaneXY(0, 0, 0))  # -> Geometry, Transform
center_2 = Center(Geometry=flatten(scale_39.Geometry), forall=True)  # -> Center, Dimension
scale_44 = Scale(Geometry=scale_18.Geometry, Center=Point(0, 0, 0), Factor=1)  # -> Geometry, Transform
loop_end_3 = LoopEnd(port=loop_start_3.port, Exit=False, Data=scale_37.Geometry, TimeOutVal=0, pausedState=False, state="Last & Record")  # -> flatten(Data)
scale_45 = Scale(Geometry=scale_18.Geometry, Center=Point(0, 0, 0), Factor=1)  # -> Geometry, Transform
circle_3 = Circle(Plane=end_points.End, Radius=deconstruct_arc_3.Radius)
circle_4 = Circle(Plane=end_points.Start, Radius=deconstruct_arc_3.Radius)
face_boundaries_3 = FaceBoundaries(Mesh=weaverbird_s_split_triangles_subdivision_4)
rotate_5 = Rotate(Geometry=circle, Angle=1.570796327, Plane=PlaneXY(0, 0, 0))  # -> Geometry, Transform
digit_scroller_16 = DigitScroller(Scroller_Digits=12, Scroller_Prefix="Digit Scroller", Scroller_Radix=11, Scroller_Value=3)
scale_46 = Scale(Geometry=graft(fast_loop_start.Data), Center=flatten(divide_curve_3.Points), Factor=0.3333333333)  # -> Geometry, Transform
digit_scroller_17 = DigitScroller(Scroller_Digits=12, Scroller_Prefix="Digit Scroller", Scroller_Radix=11, Scroller_Value=3)
digit_scroller_18 = DigitScroller(Scroller_Digits=12, Scroller_Prefix="Digit Scroller", Scroller_Radix=1, Scroller_Value=0.91068352)
geometry_13 = Geometry(cull_pattern_2)
scale_47 = Scale(Geometry=inscribed_polygon_2, Center=Point(0, 0, 0), Factor=0.6666666667)  # -> Geometry, Transform
curve_display_6 = CurveDisplay(Curves=list_item_7, Thickness=1, Color=RGB(0, 0, 255))
data_2 = Data(face_boundaries_2)
ggnetworkpatch = GgNetworkPatch(Invert=True, Surface=False)
center_3 = Center(Geometry=flatten(scale_40.Geometry), forall=True)  # -> Center, Dimension
geometry_14 = Geometry(geometry_12)
discontinuity_2 = Discontinuity(Curve=inscribed_polygon_2, Level=1)  # -> Points, Parameters
merge_9 = Merge(Data1=point_3, Data2=discontinuity_2.Points)  # -> flatten(Result)
fast_loop_end = FastLoopEnd(port=fast_loop_start.port, Exit=False, Data=scale_46.Geometry, RecordData=False, TimeOutVal=0)  # disabled
tangent_arcs = TangentArcs(CircleA=circle_4, CircleB=circle_3, Radius=min_max.Maximum)  # -> ArcA, ArcB
geometry_15 = Geometry(stream_filter)
loop_end_4 = LoopEnd(port=loop_start_4.port, Exit=False, Data=scale_41.Geometry, TimeOutVal=0, pausedState=False, state="Output last")
true_only_button_8 = TrueOnlyButton(LastSaveLocalization="neutral,N")
revolution = Revolution(Curve=tangent_arcs.ArcA, Axis=proximity_3d.Links, Domain=Domain(0, 6.283185307))  # disabled
divide_curve_8 = DivideCurve(Curve=rotate_4.Geometry, Count=2, Kinks=False)  # -> Points, Tangents, Parameters
true_only_button_9 = TrueOnlyButton(LastSaveLocalization="neutral,N")
multiplication_5 = Multiplication(A=subtraction_4, B=3)
data_3 = Data(scale_45.Geometry)
true_only_button_10 = TrueOnlyButton(LastSaveLocalization="neutral,N")
addition_5 = Addition(A=multiplication_5, B=3)
division_8 = Division(A="1", B=addition_5)
divide_curve_9 = DivideCurve(Curve=rotate_5.Geometry, Count=2, Kinks=False)  # -> Points, Tangents, Parameters
addition_6 = Addition(A=number_slider_2, B=division_8)
scale_48 = Scale(Geometry=scale_43.Geometry, Center=Point(0, 0, 0), Factor=addition_6)  # -> Geometry, Transform
merge_10 = Merge(Data1=true_only_button_10, Data2=data_3, Data3=digit_scroller_15, Data4=divide_curve_9.Points)
digit_scroller_19 = DigitScroller(Scroller_Digits=12, Scroller_Prefix="Digit Scroller", Scroller_Radix=1, Scroller_Value=0.91068352)
list_item_8 = ListItem(List=discontinuity_2.Points, Index=[1, 4], Wrap=True)
sphere = Sphere(Base=deconstruct_arc_3.BasePlane, Radius=min_max.Maximum)  # disabled
subtraction_6 = Subtraction(A=multiplication_5, B="3")
division_9 = Division(A="1", B=subtraction_6)
geometry_16 = Geometry(geometry_15)
digit_scroller_20 = DigitScroller(Scroller_Digits=12, Scroller_Prefix="Digit Scroller", Scroller_Radix=1, Scroller_Value=0.91068352)
subtraction_7 = Subtraction(A=number_slider_2, B=division_9)
scale_49 = Scale(Geometry=scale_42.Geometry, Center=Point(0, 0, 0), Factor=subtraction_7)  # -> Geometry, Transform
digit_scroller_21 = DigitScroller(Scroller_Digits=12, Scroller_Prefix="Digit Scroller", Scroller_Radix=11, Scroller_Value=1)
merge_11 = Merge(Data1=tangent_arcs.ArcA, Data2=tangent_arcs.ArcB)
geometry_17 = Geometry(loop_end_4)
merge_12 = Merge(Data1=cull_pattern_3, Data2=merge_11)
scale_50 = Scale(Geometry=merge_12, Center=Point(0, 0, 0), Factor=power_4)  # -> Geometry, Transform; disabled
ggcurvessplitintersect = GgCurvesSplitIntersect(Curves=scale_50.Geometry, Tol=power_5, SplitPoly=True, Splitters=weaverbird_s_mesh_edges)  # -> flatten(Curves); disabled
ggnetworkpatch_2 = GgNetworkPatch(Curves=flatten(ggcurvessplitintersect), Invert=True, Surface=False)  # disabled
region_union = RegionUnion(Curves=flatten(ggnetworkpatch_2))
scale_51 = Scale(Geometry=region_union, Center=Point(0, 0, 0), Factor=expr("1/X", power_4))  # -> Geometry, Transform
open_curve = OpenCurve(Curve=merge_12, Length=7.629394531e-06, Normalized=False, Seam=0)  # -> Opened, ResultBoolean
geometry_18 = Geometry(scale_51.Geometry)
smooth_corners = SmoothCorners(Curve=geometry_18, Parameter=1, BlendContinuity=1, Close=False)  # disabled
prude_curve = PrudeCurve(Curve=geometry_18, Length=1, BlendType=1, Bulge=0.5)  # -> Prude, ResultBoolean
loop_start_5 = LoopStart(Repeat=digit_scroller_15, Trigger=merge_10, Data=data_3)  # -> port, Counter, Data
digit_scroller_22 = DigitScroller(Scroller_Digits=12, Scroller_Prefix="Digit Scroller", Scroller_Radix=11, Scroller_Value=1)
merge_13 = Merge(Data1=true_only_button_8, Data2=data_2, Data3=digit_scroller_22)
loop_start_6 = LoopStart(Repeat=digit_scroller_22, Trigger=merge_13, Data=data_2)  # -> port, Counter, Data
scale_52 = Scale(Geometry=graft(loop_start_6.Data), Center=merge_9, Factor=0.3333333333)  # -> Geometry, Transform
list_item_9 = ListItem(List=list_item_8, Index=0, Wrap=True)
scale_53 = Scale(Geometry=graft(data_2), Center=list_item_9, Factor=0.3333333333)  # -> Geometry, Transform

scale_54 = Scale(Geometry=divide_curve_9.Points, Center=Point(0, 0, 0), Factor="SQRT(3)/2")  # -> Geometry, Transform

deconstruct_arc_4 = DeconstructArc(Arc=merge_12)  # -> BasePlane, Radius, Angle
merge_14 = Merge(Data1=sphere, Data2=revolution)
scale_55 = Scale(Geometry=graft(loop_start_5.Data), Center=scale_54.Geometry, Factor=0.3333333333)  # -> Geometry, Transform
data_4 = Data(data)
digit_scroller_23 = DigitScroller(Scroller_Digits=12, Scroller_Prefix="Digit Scroller", Scroller_Radix=1, Scroller_Value=0.3849)
multiplication_6 = Multiplication(A=addition_5, B=3)
addition_7 = Addition(A=multiplication_6, B=3)
division_10 = Division(A="1", B=addition_7)
addition_8 = Addition(A=number_slider_2, B=division_10)
scale_56 = Scale(Geometry=scale_48.Geometry, Center=Point(0, 0, 0), Factor=addition_8)  # -> Geometry, Transform
solid_fill_3 = SolidFill(ShapeGeometry=merge_14, Color=RGB(0, 244, 124))
vector_xyz = VectorXYZ(XComponent="2/(3*SQRT(3))/2", YComponent=0, ZComponent=0)  # -> Vector, Length
loop_end_5 = LoopEnd(port=loop_start_6.port, Exit=False, Data=scale_52.Geometry, TimeOutVal=0, pausedState=False, state="Last & Record")  # -> flatten(Data)
merge_15 = Merge(Data1=data_2, Data2=loop_end_5)  # -> flatten(Result)
geometry_19 = Geometry(circumscribed_polygon_2)
discontinuity_3 = Discontinuity(Curve=geometry_19, Level=1)  # -> Points, Parameters
power_10 = Power(A="2", B="8")  # disabled
scale_57 = Scale(Geometry=merge_12, Center=Point(0, 0, 0), Factor=power_10)  # -> Geometry, Transform; disabled
division_11 = Division(A="2", B="9")
power_11 = Power(A="2", B="-8")  # disabled
ggcurvessplitintersect_2 = GgCurvesSplitIntersect(Curves=scale_57.Geometry, Tol=power_11, SplitPoly=True)  # -> flatten(Curves); disabled
ggnetworkpatch_3 = GgNetworkPatch(Curves=ggcurvessplitintersect_2, Invert=False, Surface=False)  # disabled
scale_58 = Scale(Geometry=ggnetworkpatch_3, Center=Point(0, 0, 0), Factor=expr("1/X", power_10))  # -> Geometry, Transform; disabled
negative_3 = Negative(Value=division_11)
loop_end_6 = LoopEnd(port=loop_start_5.port, Exit=False, Data=scale_55.Geometry, TimeOutVal=0, pausedState=False, state="Last & Record")
merge_16 = Merge(Data1=data_3, Data2=loop_end_6)  # -> flatten(Result)

number_slider_6 = Slider(0, range=0..1)
stream_gate_2 = StreamGate(Stream=geometry_14, Gate=number_slider_6)  # -> Target0, Target1
solid_fill_4 = SolidFill(ShapeGeometry=stream_gate_2.Target1, Color=RGB(0, 0, 0))
stream_filter_2 = StreamFilter(Gate=number_slider_6, Stream0=stream_gate_2.Target0, Stream1=solid_fill_4)

scale_59 = Scale(Geometry=inscribed_polygon_2, Center=Point(0, 0, 0), Factor=0.6666666667)  # -> Geometry, Transform; disabled
vector_xyz_2 = VectorXYZ(XComponent=division_11, YComponent=0, ZComponent=0)  # -> Vector, Length
yz_plane = YZPlane(Origin=vector_xyz_2.Vector)
vector_xyz_3 = VectorXYZ(XComponent=negative_3, YComponent=0, ZComponent=0)  # -> Vector, Length
geometry_20 = Geometry()
scale_60 = Scale(Geometry=inscribed_polygon_2, Center=Point(0, 0, 0), Factor=0.6666666667)  # -> Geometry, Transform; disabled
custom_preview_2 = CustomPreview(
    Geometry=merge_14,
    Material={diffuse=RGB(171, 171, 171), emission=RGB(51, 51, 51), shine=0.5, specular=RGB(255, 255, 255), transparency=0})
list_item_10 = ListItem(List=loop_end_6, Index=0, Wrap=True)
collision_one_many_4 = CollisionOneMany(Collider=flatten(loop_end_5), Obstacles=flatten(geometry_20))  # -> Collision, Index; disabled
geometry_21 = Geometry()
collision_one_many_5 = CollisionOneMany(Collider=flatten(loop_end_6), Obstacles=flatten(geometry_21))  # -> Collision, Index
multiplication_7 = Multiplication(A=addition_7, B=3)
addition_9 = Addition(A=multiplication_7, B=3)
division_12 = Division(A="1", B=addition_9)
addition_10 = Addition(A=number_slider_2, B=division_12)
scale_61 = Scale(Geometry=scale_56.Geometry, Center=Point(0, 0, 0), Factor=addition_10)  # -> Geometry, Transform
deconstruct_arc_5 = DeconstructArc(Arc=list_item_10)  # -> BasePlane, Radius, Angle
scale_62 = Scale(Geometry=list_item_10, Center=deconstruct_arc_5.BasePlane, Factor=0.3333333333)  # -> Geometry, Transform
curve_display_7 = CurveDisplay(Curves=merge_12, Thickness=2, Color=RGB(0, 0, 255))
rotate_6 = Rotate(Geometry=loop_end_6, Angle=degrees(-30), Plane=PlaneXY(0, 0, 0))  # -> Geometry, Transform
orient_2 = Orient(Geometry=scale_39.Geometry, Source=center_2.Center, Target=divide_curve_4.Points)  # -> Geometry, Transform
orient_3 = Orient(Geometry=list_item_7, Source=center.Center, Target=divide_curve_2.Points)  # -> Geometry, Transform
orient_4 = Orient(Geometry=scale_40.Geometry, Source=center_3.Center, Target=divide_curve_7.Points)  # -> Geometry, Transform
panel_4 = Panel(deconstruct_arc_5.Radius)
power_12 = Power(A="3", B="-2")
digit_scroller_24 = DigitScroller(Scroller_Digits=12, Scroller_Prefix="Digit Scroller", Scroller_Radix=1, Scroller_Value=0.388888882)
panel_5 = Panel("2/(3*SQRT(3))")
project = Project(Geometry=scale_62.Geometry, Plane=PlaneYZ(0, 0, 0))  # -> Geometry, Transform
rotate_7 = Rotate(Geometry=project.Geometry, Angle=degrees(-90), Plane=PlaneXY(0, 0, 0))  # -> Geometry, Transform
geometry_22 = Geometry(rotate_7.Geometry)
rotate_8 = Rotate(Geometry=geometry_22, Angle=degrees(60), Plane=PlaneXY(0, 0, 0))  # -> Geometry, Transform
move = Move(Geometry=rotate_8.Geometry, Motion=Vector(0.3333333333, 0, 0))  # -> Geometry, Transform
extrude2side = Extrude2Side(Curve=move.Geometry, Direction=scale_27.Geometry, Bothside=True, SplitKinkyFaces=False, Bake=False, Cap=False)
brep_wireframe = BrepWireframe(Brep=flatten(extrude2side), Density=4)
polar_array_2 = PolarArray(Geometry=extrude2side, Plane=PlaneXY(0, 0, 0), Count=3, Angle=6.283185307)  # -> Geometry, Transform; disabled
plane_trim_planes = PlaneTrimPlanes(Planes=flatten(extrude2side), Plane=xz_plane, Flip=True)  # -> Trimmed, KeptIndicies, Intersected
boundary_surfaces_7 = BoundarySurfaces(Edges=brep_wireframe)
brep_wireframe_2 = BrepWireframe(Brep=polar_array_2.Geometry, Density=1)
deconstruct_brep = DeconstructBrep(Brep=polar_array_2.Geometry)  # -> flatten(Faces), Edges, Vertices
panel_6 = Panel("7/(9*SQRT(3))")
colour_swatch_3 = ColourSwatch(SwatchColor=RGB(0, 244, 124))
list_item_11 = ListItem(List=divide_curve.Points, Index=0, Wrap=True)

number_slider_7 = Slider(0, range=0..1)
stream_gate_3 = StreamGate(Stream=stream_filter_2, Gate=number_slider_7)  # -> Target0, Target1
shape_data = ShapeData(ShapeGeometry=stream_gate_3.Target1, ID=" ", Hover=False)
stream_filter_3 = StreamFilter(Gate=number_slider_7, Stream0=stream_gate_3.Target0, Stream1=shape_data)

scale_63 = Scale(Geometry=circumscribed_polygon_2, Center=Point(0, 0, 0), Factor=power_12)  # -> Geometry, Transform
railrevolve = RailRevolve(Profile=rotate_7.Geometry, Rail=scale_63.Geometry, Axis=Line((0, 0, 0), (0, 0, 1)), ScaleHeight=True, SplitKFaces=False)
geometry_23 = Geometry(scale_63.Geometry)
brep_wireframe_3 = BrepWireframe(Brep=railrevolve, Density=-1)
merge_17 = Merge(Data1=brep_wireframe_3, Data2=brep_wireframe_2)  # -> flatten(Result)
merge_18 = Merge(Data1=railrevolve, Data2=polar_array_2.Geometry)
brep_join = BrepJoin(Breps=flatten(merge_18))  # -> Breps, Closed
data_5 = Data(merge_18)
merge_19 = Merge(Data1=true_only_button_9, Data2=data_5, Data3=digit_scroller_21, Data4=divide_curve_8.Points)
loop_start_7 = LoopStart(Repeat=digit_scroller_21, Trigger=merge_19, Data=data_5)  # -> port, Counter, Data
scale_64 = Scale(Geometry=graft(loop_start_7.Data), Center=discontinuity_3.Points, Factor=0.3333333333)  # -> Geometry, Transform
loop_end_7 = LoopEnd(port=loop_start_7.port, Exit=False, Data=scale_64.Geometry, TimeOutVal=0, pausedState=False, state="Last & Record")
merge_20 = Merge(Data1=data_5, Data2=loop_end_7)  # -> flatten(Result)
custom_preview_3 = CustomPreview(
    Geometry=merge_18,
    Material={diffuse=RGB(171, 171, 171), emission=RGB(51, 51, 51), shine=0.5, specular=RGB(255, 255, 255), transparency=0})
number_slider_8 = Slider(1, range=0..3)
scale_65 = Scale(Geometry=list_item_11, Center=Point(0, 0, 0), Factor=0.3333333333)  # -> Geometry, Transform
scale_66 = Scale(Geometry=list_item_7, Center=scale_65.Geometry, Factor=0.3333333333)  # -> Geometry, Transform
scale_67 = Scale(Geometry=scale_66.Geometry, Center=scale_65.Geometry, Factor=0.3333333333)  # -> Geometry, Transform
scale_68 = Scale(Geometry=scale_67.Geometry, Center=scale_65.Geometry, Factor=0.3333333333)  # -> Geometry, Transform
number_2 = Number("7/18")
list_item_12 = ListItem(List=flatten(rotate_7.Geometry), Index=0, Wrap=True)
curve_middle = CurveMiddle(Curve=list_item_12)
scale_69 = Scale(Geometry=list_item_12, Center=curve_middle, Factor=9)  # -> Geometry, Transform
power_13 = Power(A="3", B="6")

number_slider_9 = Slider(0, range=0..1)
stream_gate_4 = StreamGate(Stream=stream_filter_3, Gate=number_slider_9)  # -> Target0, Target1
construct_drawing = ConstructDrawing(
    ShapesGeometry=stream_gate_4.Target1,
    Boundary=rectangle.Rectangle,
    Width=power_13,
    Height=power_13,
    Color=RGBA(255, 255, 255, 0))  # -> Drawing, Boundary
stream_filter_4 = StreamFilter(Gate=number_slider_9, Stream0=stream_gate_4.Target0, Stream1=construct_drawing.Drawing)

evaluate_length = EvaluateLength(Curve=scale_69.Geometry, Length=[0.25, 0.75], Normalized=True)  # -> Point, Tangent, Parameter
drawing_viewer = DrawingViewer(DrawingsShapesGeometry=flatten(stream_filter_4), Resolution=96)  # disabled

bounding_rectangle = BoundingRectangle(Content=circle, Plane=PlaneXY(0, 0, 0))
power_14 = Power(A="3", B="6")

digit_scroller_25 = DigitScroller(Scroller_Digits=12, Scroller_Prefix="Digit Scroller", Scroller_Radix=11, Scroller_Value=0)
digit_scroller_26 = DigitScroller(Scroller_Digits=12, Scroller_Prefix="Digit Scroller", Scroller_Radix=11, Scroller_Value=0)

larger_than = LargerThan(FirstNumber=digit_scroller_25, SecondNumber=0)  # -> LargerThan, OrEqualTo
merge_21 = Merge(Data1=true_only_button_7, Data2=digit_scroller_26, Data3=list_item_4)  # -> flatten(Result)
merge_22 = Merge(Data1=true_only_button_5, Data2=digit_scroller_26, Data3=scale_17.Geometry, Data4=digit_scroller_13)  # -> flatten(Result)
number_3 = Number(digit_scroller_26)
addition_11 = Addition(A=number_3, B="0")
loop_start_8 = LoopStart(Repeat=number_3, Trigger=merge_22, Data=scale_17.Geometry, D1="1", D2="3")  # -> port, Counter, Data, Data_2, Data_3
loop_start_9 = LoopStart(Repeat=addition_11, Trigger=merge_21, Data=list_item_4, D1="1", D2="3")  # -> port, Counter, Data, Data_2, Data_3
division_13 = Division(A="1", B=loop_start_9.Data_3)
division_14 = Division(A=digit_scroller_13, B=loop_start_8.Data_3)
subtraction_8 = Subtraction(A=loop_start_8.Data_2, B=division_14)
addition_12 = Addition(A=loop_start_8.Data_2, B=division_14)
subtraction_9 = Subtraction(A=loop_start_9.Data_2, B=division_13)
larger_than_2 = LargerThan(FirstNumber=digit_scroller_25, SecondNumber=0)  # -> LargerThan, OrEqualTo
addition_13 = Addition(A=loop_start_9.Data_2, B=division_13)
merge_23 = Merge(Data1=addition_12, Data2=subtraction_8)
scale_70 = Scale(Geometry=graft(loop_start_8.Data), Center=Point(0, 0, 0), Factor=merge_23)  # -> Geometry, Transform
multiplication_8 = Multiplication(A=loop_start_8.Data_3, B=digit_scroller_16)
merge_24 = Merge(Data1=addition_13, Data2=subtraction_9)
larger_than_3 = LargerThan(FirstNumber=number_3, SecondNumber=0)  # -> LargerThan, OrEqualTo
multiplication_9 = Multiplication(A=loop_start_9.Data_3, B=digit_scroller_17)
scale_71 = Scale(Geometry=graft(loop_start_9.Data), Center=Point(0, 0, 0), Factor=merge_24)  # -> Geometry, Transform
addition_14 = Addition(A=multiplication_8, B=digit_scroller_16)
subtraction_10 = Subtraction(A=multiplication_8, B=digit_scroller_16)
merge_25 = Merge(Data1=addition_14, Data2=subtraction_10)  # -> graft(Result)
addition_15 = Addition(A=multiplication_9, B=digit_scroller_17)
subtraction_11 = Subtraction(A=multiplication_9, B=digit_scroller_17)
loop_end_8 = LoopEnd(
    port=loop_start_8.port,
    Exit=False,
    Data=scale_70.Geometry,
    Data_2=loop_start_8.Data_2,
    Data_3=merge_25,
    TimeOutVal=0,
    pausedState=False,
    state="Last & Record")  # -> Data, D1, D2
merge_26 = Merge(Data1=addition_15, Data2=subtraction_11)  # -> graft(Result)
loop_end_9 = LoopEnd(
    port=loop_start_9.port,
    Exit=False,
    Data=scale_71.Geometry,
    Data_2=loop_start_9.Data_2,
    Data_3=merge_26,
    TimeOutVal=0,
    pausedState=False,
    state="Last & Record")  # -> Data, D1, D2
merge_27 = Merge(Data1=scale_17.Geometry, Data2=loop_end_8.Data)
merge_28 = Merge(Data1=list_item_4, Data2=loop_end_9.Data)
stream_filter_5 = StreamFilter(Gate=larger_than_3.OrEqualTo, Stream0=scale_17.Geometry, Stream1=merge_27)

scale_72 = Scale(Geometry=stream_filter_5, Center=Point(0, 0, 0), Factor="SQRT(3)/2")  # -> Geometry, Transform

geometry_24 = Geometry(merge_28)
curve_display_8 = CurveDisplay(Curves=geometry_24, Thickness=3, Color=RGB(71, 255, 117))
mirror_cut_curve = MirrorCutCurve(Curve=merge_28, MirrorPlane=yz_plane, Reach=0, Offset=0, Flip=True, Join=False, Keep=False, ConnectionType=0, Bulge=0.5)  # -> MirrorCut, SplitIndex, ReachPlane, OffsetPlane, Intersected
geometry_25 = Geometry(stream_filter_5)
geometry_26 = Geometry(scale_72.Geometry)
move_2 = Move(Geometry=mirror_cut_curve.MirrorCut, Motion=vector_xyz_3.Vector)  # -> Geometry, Transform
scale_73 = Scale(Geometry=move_2.Geometry, Center=Point(0, 0, 0), Factor="SQRT(3)/2")  # -> Geometry, Transform
extend_curve = ExtendCurve(Curve=scale_73.Geometry, Type=0, Start=number_2, End=number_2)
polar_array_3 = PolarArray(Geometry=extend_curve, Plane=PlaneXY(0, 0, 0), Count=3, Angle=6.283185307)  # -> Geometry, Transform

merge_29 = Merge(Data1=geometry_25, Data2=polar_array_3.Geometry)

data_6 = Data(merge_29)
merge_30 = Merge(Data1=true_only_button, Data2=data_6, Data3=digit_scroller_25)
loop_start_10 = LoopStart(Repeat=digit_scroller_25, Trigger=merge_30, Data=data_6)  # -> port, Counter, Data
scale_74 = Scale(Geometry=graft(loop_start_10.Data), Center=flatten(merge_5), Factor=0.3333333333)  # -> Geometry, Transform
loop_end_10 = LoopEnd(port=loop_start_10.port, Exit=False, Data=scale_74.Geometry, TimeOutVal=0, pausedState=False, state="Last & Record")  # -> flatten(Data)
merge_31 = Merge(Data1=merge_29, Data2=loop_end_10)
stream_filter_6 = StreamFilter(Gate=larger_than.OrEqualTo, Stream0=data_6, Stream1=merge_31)

geometry_27 = Geometry(stream_filter_6)

curve_display_9 = CurveDisplay(Curves=geometry_27, Thickness=1, Color=RGB(0, 244, 124))
stream_filter_7 = StreamFilter(Gate=larger_than_2.OrEqualTo, Stream0=merge_29, Stream1=geometry_27)

geometry_28 = Geometry(flatten(stream_filter_7))
curve_display_10 = CurveDisplay(Curves=geometry_28, Thickness=2, Color=RGB(102, 102, 102))

number_slider_10 = Slider(1, range=0..1)

stream_gate_5 = StreamGate(Stream=geometry_16, Gate=number_slider_10)  # -> Target0, Target1
collision_one_many_6 = CollisionOneMany(Collider=flatten(stream_gate_5.Target1), Obstacles=geometry_28)  # -> Collision, Index
cull_pattern_6 = CullPattern(List=flatten(geometry_16), CullPattern=collision_one_many_6.Collision)

stream_filter_8 = StreamFilter(Gate=number_slider_10, Stream0=stream_gate_5.Target0, Stream1=cull_pattern_6)

merge_32 = Merge(Data1=scale_18.Geometry, Data2=stream_filter_8)
stream_gate_6 = StreamGate(Stream=merge_32, Gate=number_slider_8)  # -> Target0, Target1, Target2, Target3
boundary_surfaces_8 = BoundarySurfaces(Edges=stream_gate_6.Target1)
collision_many_many_2 = CollisionManyMany(Colliders=stream_gate_6.Target2)  # -> Collision, Indices
boundary_surfaces_9 = BoundarySurfaces(Edges=stream_gate_6.Target3)
collision_many_many_3 = CollisionManyMany(Colliders=boundary_surfaces_9)  # -> Collision, Indices
cull_pattern_7 = CullPattern(List=stream_gate_6.Target2, CullPattern=invert(collision_many_many_2.Collision))
cull_pattern_8 = CullPattern(List=stream_gate_6.Target2, CullPattern=collision_many_many_2.Collision)
cull_pattern_9 = CullPattern(List=boundary_surfaces_9, CullPattern=invert(collision_many_many_3.Collision))
cull_pattern_10 = CullPattern(List=boundary_surfaces_9, CullPattern=collision_many_many_3.Collision)
solid_union_2 = SolidUnion(Breps=cull_pattern_8)
merge_33 = Merge(Data1=cull_pattern_7, Data2=solid_union_2)
solid_union_3 = SolidUnion(Breps=cull_pattern_10)
merge_34 = Merge(Data1=cull_pattern_9, Data2=solid_union_3)
stream_filter_9 = StreamFilter(Gate=number_slider_8, Stream0=stream_gate_6.Target0, Stream1=boundary_surfaces_8, Stream2=merge_33, Stream3=merge_34)

curve_display_11 = CurveDisplay(Curves=geometry_27, Thickness=1, Color=colour_swatch_3)
merge_35 = Merge(Data1=stream_filter_9)
curve_display_12 = CurveDisplay(Curves=merge_35, Thickness=2, Color=RGB(0, 244, 124))
custom_preview_4 = CustomPreview(Geometry=merge_35, Material=colour_swatch_3)

stroke_3 = Stroke(ShapeGeometry=merge_35, Color=colour_swatch_3, Weight=0, EndCap=2)
solid_fill_5 = SolidFill(ShapeGeometry=stroke_3, Color=colour_swatch_3)
merge_36 = Merge(Data1=solid_fill, Data2=solid_fill_2, Data3=solid_fill_5)
shape_data_2 = ShapeData(ShapeGeometry=merge_36, ID=" ", Hover=False)

construct_drawing_2 = ConstructDrawing(
    ShapesGeometry=flatten(shape_data_2),
    Boundary=bounding_rectangle,
    Width=power_14,
    Height=power_14,
    Color=RGBA(255, 255, 255, 0))  # -> Drawing, Boundary
drawing_viewer_2 = DrawingViewer(DrawingsShapesGeometry=construct_drawing_2.Drawing, Resolution=96)

save_svg = SaveSvg(DrawingsShapesGeometry=construct_drawing_2.Drawing, FolderPath="C:\", FileName="ϱvƨ.", Save=True)
