# Grasshopper definition XHꓨ.​      𑁍      ​◦୦◦◯◦୦◦⠀       ⠀◦୦◦◯◦୦◦​      𑁍      ​.GHX (Grasshopper 1.0.7)
# plug-ins: Nautilus, treesloth01, Kangaroo2 Components, GhPython Script, Anemone, eleFront

apollonian_gasket_array_of_circles = ApollonianGasketArrayOfCircles(
    Circle={Plane=PlaneXY(0, 0, 0), Radius=0.5},
    NumberOfCircles=4,
    Recursions=3,
    MinRadius=0,
    Tolerance=1.525878906e-05,
    Parallel=True)  # -> Circles, Curves
digit_scroller = DigitScroller(Scroller_Digits=12, Scroller_Prefix="Digit Scroller", Scroller_Radix=11, Scroller_Value=7)
apollonian_gasket_array_of_circles_2 = ApollonianGasketArrayOfCircles(
    Circle={Plane=PlaneXY(0, 0, 0), Radius=0.5},
    NumberOfCircles=4,
    Recursions=3,
    MinRadius=0,
    Tolerance=1.525878906e-05,
    Parallel=False)  # -> Circles, Curves
digit_scroller_2 = DigitScroller(Scroller_Digits=12, Scroller_Prefix="Digit Scroller", Scroller_Radix=11, Scroller_Value=24)
flip_matrix = FlipMatrix(Data=apollonian_gasket_array_of_circles.Circles)
apollonian_gasket_array_of_circles_3 = ApollonianGasketArrayOfCircles(Circle={Plane=PlaneXY(0, 0, 0), Radius=0.5}, NumberOfCircles=4, Recursions=4, MinRadius=0, Tolerance=0, Parallel=False)  # -> Circles, Curves
list_item = ListItem(List=flip_matrix, Index=5, Wrap=False)
digit_scroller_3 = DigitScroller(Scroller_Digits=12, Scroller_Prefix="Digit Scroller", Scroller_Radix=11, Scroller_Value=23)
digit_scroller_4 = DigitScroller(Scroller_Digits=12, Scroller_Prefix="Digit Scroller", Scroller_Radix=11, Scroller_Value=13)
flip_matrix_2 = FlipMatrix(Data=apollonian_gasket_array_of_circles_2.Circles)
list_item_2 = ListItem(List=flip_matrix_2, Index=2, Wrap=False)
cull_index = CullIndex(List=flatten(list_item_2), Indices=[0, 1, 2, 3], Wrap=True)
list_item_3 = ListItem(List=flatten(list_item), Index=[9, 10, 16, 17, 19, 20, 22, 23], Wrap=False)
list_item_4 = ListItem(List=flatten(list_item), Index=digit_scroller, Wrap=False)
flip_last = FlipLast(Data=apollonian_gasket_array_of_circles_2.Circles)
list_item_5 = ListItem(List=flatten(flip_matrix_2), Index=digit_scroller_4, Wrap=True)
pi = Pi(Factor=1)
cull_index_2 = CullIndex(List=flatten(list_item), Indices=[0, 1, 2, 3, 4, 5, 6, 7, 8, 13, 14, 15], Wrap=True)
geometry = Geometry(flatten(apollonian_gasket_array_of_circles_2.Circles))
list_item_6 = ListItem(List=flip_last, Index=0, Wrap=True)
flip_matrix_3 = FlipMatrix(Data=apollonian_gasket_array_of_circles_3.Circles)
list_item_7 = ListItem(List=flip_matrix_3, Index=1, Wrap=True)
list_item_8 = ListItem(List=flatten(list_item_2), Index=[0, 1, 2, 3], Wrap=False)
list_item_9 = ListItem(List=flatten(list_item_7), Index=0, Wrap=True)
list_item_10 = ListItem(List=list_item_8, Index=3, Wrap=False)
evaluate_length = EvaluateLength(Curve=list_item_10, Length=0.5, Normalized=True)  # -> Point, Tangent, Parameter
list_item_11 = ListItem(List=flip_last, Index=1, Wrap=True)
list_item_12 = ListItem(List=flatten(apollonian_gasket_array_of_circles_2.Circles), Index=0, Wrap=True)
rectangle = Rectangle(Plane=PlaneXY(0, 0, 0), XSize=Domain(0, 0.5), YSize=Domain(-0.3333333333, 0.3333333333), Radius=0)  # -> Rectangle, Length
merge = Merge(Data1=list_item_12, Data2=list_item_7, Data3=list_item_8, Data4=list_item_3)
list_item_13 = ListItem(List=flatten(merge), Index=1, Wrap=True)
merge_2 = Merge(Data1=list_item_12, Data2=list_item_10, Data3=list_item_9)
circle_tantantan = CircleTanTanTan(CurveA=list_item_12, CurveB=list_item_10, CurveC=list_item_9, Point=evaluate_length.Point)
evaluate_length_2 = EvaluateLength(Curve=circle_tantantan, Length=0.75, Normalized=True)  # -> Point, Tangent, Parameter
circle_tantantan_2 = CircleTanTanTan(CurveA=list_item_12, CurveB=circle_tantantan, CurveC=list_item_9, Point=evaluate_length_2.Point)
evaluate_length_3 = EvaluateLength(Curve=circle_tantantan_2, Length=0.75, Normalized=True)  # -> Point, Tangent, Parameter
circle_tantantan_3 = CircleTanTanTan(CurveA=list_item_12, CurveB=circle_tantantan_2, CurveC=list_item_9, Point=evaluate_length_3.Point)
evaluate_length_4 = EvaluateLength(Curve=circle_tantantan_3, Length=0.75, Normalized=True)  # -> Point, Tangent, Parameter
circle_tantantan_4 = CircleTanTanTan(CurveA=list_item_12, CurveB=circle_tantantan_3, CurveC=list_item_9, Point=evaluate_length_4.Point)
evaluate_length_5 = EvaluateLength(Curve=circle_tantantan_4, Length=0.75, Normalized=True)  # -> Point, Tangent, Parameter
circle_tantantan_5 = CircleTanTanTan(CurveA=list_item_12, CurveB=circle_tantantan_4, CurveC=list_item_9, Point=evaluate_length_5.Point)
evaluate_length_6 = EvaluateLength(Curve=circle_tantantan_5, Length=0.75, Normalized=True)  # -> Point, Tangent, Parameter
circle_tantantan_6 = CircleTanTanTan(CurveA=list_item_12, CurveB=circle_tantantan_5, CurveC=list_item_9, Point=evaluate_length_6.Point)
evaluate_length_7 = EvaluateLength(Curve=circle_tantantan_6, Length=0.75, Normalized=True)  # -> Point, Tangent, Parameter
circle_tantantan_7 = CircleTanTanTan(CurveA=list_item_12, CurveB=circle_tantantan_6, CurveC=list_item_9, Point=evaluate_length_7.Point)
evaluate_length_8 = EvaluateLength(Curve=circle_tantantan_7, Length=0.75, Normalized=True)  # -> Point, Tangent, Parameter
circle_tantantan_8 = CircleTanTanTan(CurveA=list_item_12, CurveB=circle_tantantan_7, CurveC=list_item_9, Point=evaluate_length_8.Point)
evaluate_length_9 = EvaluateLength(Curve=circle_tantantan_8, Length=0.75, Normalized=True)  # -> Point, Tangent, Parameter
evaluate_length_10 = EvaluateLength(Curve=circle_tantantan_8, Length=0.75, Normalized=True)  # -> Point, Tangent, Parameter
circle_tantantan_9 = CircleTanTanTan(CurveA=list_item_12, CurveB=circle_tantantan_8, CurveC=list_item_9, Point=evaluate_length_9.Point)
circle_tantantan_10 = CircleTanTanTan(CurveA=list_item_12, CurveB=circle_tantantan_8, CurveC=list_item_9, Point=evaluate_length_10.Point)
evaluate_length_11 = EvaluateLength(Curve=circle_tantantan_10, Length=0.75, Normalized=True)  # -> Point, Tangent, Parameter
circle_tantantan_11 = CircleTanTanTan(CurveA=list_item_12, CurveB=circle_tantantan_10, CurveC=list_item_9, Point=evaluate_length_11.Point)
evaluate_length_12 = EvaluateLength(Curve=circle_tantantan_11, Length=0.75, Normalized=True)  # -> Point, Tangent, Parameter
circle_tantantan_12 = CircleTanTanTan(CurveA=list_item_12, CurveB=circle_tantantan_11, CurveC=list_item_9, Point=evaluate_length_12.Point)
evaluate_length_13 = EvaluateLength(Curve=circle_tantantan_12, Length=0.75, Normalized=True)  # -> Point, Tangent, Parameter
circle_tantantan_13 = CircleTanTanTan(CurveA=list_item_12, CurveB=circle_tantantan_12, CurveC=list_item_9, Point=evaluate_length_13.Point)
evaluate_length_14 = EvaluateLength(Curve=circle_tantantan_13, Length=0.75, Normalized=True)  # -> Point, Tangent, Parameter
circle_tantantan_14 = CircleTanTanTan(CurveA=list_item_12, CurveB=circle_tantantan_13, CurveC=list_item_9, Point=evaluate_length_14.Point)
evaluate_length_15 = EvaluateLength(Curve=circle_tantantan_14, Length=0.75, Normalized=True)  # -> Point, Tangent, Parameter
circle_tantantan_15 = CircleTanTanTan(CurveA=list_item_12, CurveB=circle_tantantan_14, CurveC=list_item_9, Point=evaluate_length_15.Point)
evaluate_length_16 = EvaluateLength(Curve=circle_tantantan_15, Length=0.75, Normalized=True)  # -> Point, Tangent, Parameter
circle_tantantan_16 = CircleTanTanTan(CurveA=list_item_12, CurveB=circle_tantantan_15, CurveC=list_item_9, Point=evaluate_length_16.Point)
evaluate_length_17 = EvaluateLength(Curve=circle_tantantan_16, Length=0.75, Normalized=True)  # -> Point, Tangent, Parameter
circle_tantantan_17 = CircleTanTanTan(CurveA=list_item_12, CurveB=circle_tantantan_16, CurveC=list_item_9, Point=evaluate_length_17.Point)
evaluate_length_18 = EvaluateLength(Curve=circle_tantantan_17, Length=0.75, Normalized=True)  # -> Point, Tangent, Parameter
merge_3 = Merge(Data1=list_item_12, Data2=list_item_7, Data3=cull_index, Data4=list_item_3)
circle_tantantan_18 = CircleTanTanTan(CurveA=list_item_12, CurveB=circle_tantantan_17, CurveC=list_item_9, Point=evaluate_length_18.Point)
evaluate_length_19 = EvaluateLength(Curve=circle_tantantan_18, Length=0.75, Normalized=True)  # -> Point, Tangent, Parameter
circle_tantantan_19 = CircleTanTanTan(CurveA=list_item_12, CurveB=circle_tantantan_18, CurveC=list_item_9, Point=evaluate_length_19.Point)
evaluate_length_20 = EvaluateLength(Curve=circle_tantantan_19, Length=0.75, Normalized=True)  # -> Point, Tangent, Parameter
circle_tantantan_20 = CircleTanTanTan(CurveA=list_item_12, CurveB=circle_tantantan_19, CurveC=list_item_9, Point=evaluate_length_20.Point)
evaluate_length_21 = EvaluateLength(Curve=circle_tantantan_20, Length=0.75, Normalized=True)  # -> Point, Tangent, Parameter
circle_tantantan_21 = CircleTanTanTan(CurveA=list_item_12, CurveB=circle_tantantan_20, CurveC=list_item_9, Point=evaluate_length_21.Point)
evaluate_length_22 = EvaluateLength(Curve=circle_tantantan_21, Length=0.75, Normalized=True)  # -> Point, Tangent, Parameter
circle_tantantan_22 = CircleTanTanTan(CurveA=list_item_12, CurveB=circle_tantantan_21, CurveC=list_item_9, Point=evaluate_length_22.Point)
evaluate_length_23 = EvaluateLength(Curve=circle_tantantan_22, Length=0.75, Normalized=True)  # -> Point, Tangent, Parameter
circle_tantantan_23 = CircleTanTanTan(CurveA=list_item_12, CurveB=circle_tantantan_22, CurveC=list_item_9, Point=evaluate_length_23.Point)
evaluate_length_24 = EvaluateLength(Curve=circle_tantantan_23, Length=0.75, Normalized=True)  # -> Point, Tangent, Parameter
circle_tantantan_24 = CircleTanTanTan(CurveA=list_item_12, CurveB=circle_tantantan_23, CurveC=list_item_9, Point=evaluate_length_24.Point)
evaluate_length_25 = EvaluateLength(Curve=circle_tantantan_24, Length=0.75, Normalized=True)  # -> Point, Tangent, Parameter
evaluate_length_26 = EvaluateLength(Curve=circle_tantantan_24, Length=0.75, Normalized=True)  # -> Point, Tangent, Parameter
circle_tantantan_25 = CircleTanTanTan(CurveA=list_item_12, CurveB=circle_tantantan_24, CurveC=list_item_9, Point=evaluate_length_25.Point)
circle_tantantan_26 = CircleTanTanTan(CurveA=list_item_12, CurveB=circle_tantantan_24, CurveC=list_item_9, Point=evaluate_length_26.Point)
evaluate_length_27 = EvaluateLength(Curve=circle_tantantan_26, Length=0.75, Normalized=True)  # -> Point, Tangent, Parameter
circle_tantantan_27 = CircleTanTanTan(CurveA=list_item_12, CurveB=circle_tantantan_26, CurveC=list_item_9, Point=evaluate_length_27.Point)
evaluate_length_28 = EvaluateLength(Curve=circle_tantantan_27, Length=0.75, Normalized=True)  # -> Point, Tangent, Parameter
circle_tantantan_28 = CircleTanTanTan(CurveA=list_item_12, CurveB=circle_tantantan_27, CurveC=list_item_9, Point=evaluate_length_28.Point)
evaluate_length_29 = EvaluateLength(Curve=circle_tantantan_28, Length=0.75, Normalized=True)  # -> Point, Tangent, Parameter
circle_tantantan_29 = CircleTanTanTan(CurveA=list_item_12, CurveB=circle_tantantan_28, CurveC=list_item_9, Point=evaluate_length_29.Point)
evaluate_length_30 = EvaluateLength(Curve=circle_tantantan_29, Length=0.75, Normalized=True)  # -> Point, Tangent, Parameter
circle_tantantan_30 = CircleTanTanTan(CurveA=list_item_12, CurveB=circle_tantantan_29, CurveC=list_item_9, Point=evaluate_length_30.Point)
evaluate_length_31 = EvaluateLength(Curve=circle_tantantan_30, Length=0.75, Normalized=True)  # -> Point, Tangent, Parameter
circle_tantantan_31 = CircleTanTanTan(CurveA=list_item_12, CurveB=circle_tantantan_30, CurveC=list_item_9, Point=evaluate_length_31.Point)
evaluate_length_32 = EvaluateLength(Curve=circle_tantantan_31, Length=0.75, Normalized=True)  # -> Point, Tangent, Parameter
circle_tantantan_32 = CircleTanTanTan(CurveA=list_item_12, CurveB=circle_tantantan_31, CurveC=list_item_9, Point=evaluate_length_32.Point)
evaluate_length_33 = EvaluateLength(Curve=circle_tantantan_32, Length=0.75, Normalized=True)  # -> Point, Tangent, Parameter
circle_tantantan_33 = CircleTanTanTan(CurveA=list_item_12, CurveB=circle_tantantan_32, CurveC=list_item_9, Point=evaluate_length_33.Point)
evaluate_length_34 = EvaluateLength(Curve=circle_tantantan_33, Length=0.75, Normalized=True)  # -> Point, Tangent, Parameter
circle_tantantan_34 = CircleTanTanTan(CurveA=list_item_12, CurveB=circle_tantantan_33, CurveC=list_item_9, Point=evaluate_length_34.Point)
evaluate_length_35 = EvaluateLength(Curve=circle_tantantan_34, Length=0.75, Normalized=True)  # -> Point, Tangent, Parameter
circle_tantantan_35 = CircleTanTanTan(CurveA=list_item_12, CurveB=circle_tantantan_34, CurveC=list_item_9, Point=evaluate_length_35.Point)
evaluate_length_36 = EvaluateLength(Curve=circle_tantantan_35, Length=0.75, Normalized=True)  # -> Point, Tangent, Parameter
circle_tantantan_36 = CircleTanTanTan(CurveA=list_item_12, CurveB=circle_tantantan_35, CurveC=list_item_9, Point=evaluate_length_36.Point)
evaluate_length_37 = EvaluateLength(Curve=circle_tantantan_36, Length=0.75, Normalized=True)  # -> Point, Tangent, Parameter
circle_tantantan_37 = CircleTanTanTan(CurveA=list_item_12, CurveB=circle_tantantan_36, CurveC=list_item_9, Point=evaluate_length_37.Point)
evaluate_length_38 = EvaluateLength(Curve=circle_tantantan_37, Length=0.75, Normalized=True)  # -> Point, Tangent, Parameter
circle_tantantan_38 = CircleTanTanTan(CurveA=list_item_12, CurveB=circle_tantantan_37, CurveC=list_item_9, Point=evaluate_length_38.Point)
evaluate_length_39 = EvaluateLength(Curve=circle_tantantan_38, Length=0.75, Normalized=True)  # -> Point, Tangent, Parameter
circle_tantantan_39 = CircleTanTanTan(CurveA=list_item_12, CurveB=circle_tantantan_38, CurveC=list_item_9, Point=evaluate_length_39.Point)
evaluate_length_40 = EvaluateLength(Curve=circle_tantantan_39, Length=0.75, Normalized=True)  # -> Point, Tangent, Parameter
circle_tantantan_40 = CircleTanTanTan(CurveA=list_item_12, CurveB=circle_tantantan_39, CurveC=list_item_9, Point=evaluate_length_40.Point)
evaluate_length_41 = EvaluateLength(Curve=circle_tantantan_40, Length=0.75, Normalized=True)  # -> Point, Tangent, Parameter
evaluate_length_42 = EvaluateLength(Curve=circle_tantantan_40, Length=0.75, Normalized=True)  # -> Point, Tangent, Parameter
circle_tantantan_41 = CircleTanTanTan(CurveA=list_item_12, CurveB=circle_tantantan_40, CurveC=list_item_9, Point=evaluate_length_41.Point)
circle_tantantan_42 = CircleTanTanTan(CurveA=list_item_12, CurveB=circle_tantantan_40, CurveC=list_item_9, Point=evaluate_length_42.Point)
evaluate_length_43 = EvaluateLength(Curve=circle_tantantan_42, Length=0.75, Normalized=True)  # -> Point, Tangent, Parameter
circle_tantantan_43 = CircleTanTanTan(CurveA=list_item_12, CurveB=circle_tantantan_42, CurveC=list_item_9, Point=evaluate_length_43.Point)
evaluate_length_44 = EvaluateLength(Curve=circle_tantantan_43, Length=0.75, Normalized=True)  # -> Point, Tangent, Parameter
circle_tantantan_44 = CircleTanTanTan(CurveA=list_item_12, CurveB=circle_tantantan_43, CurveC=list_item_9, Point=evaluate_length_44.Point)
evaluate_length_45 = EvaluateLength(Curve=circle_tantantan_44, Length=0.75, Normalized=True)  # -> Point, Tangent, Parameter
circle_tantantan_45 = CircleTanTanTan(CurveA=list_item_12, CurveB=circle_tantantan_44, CurveC=list_item_9, Point=evaluate_length_45.Point)
evaluate_length_46 = EvaluateLength(Curve=circle_tantantan_45, Length=0.75, Normalized=True)  # -> Point, Tangent, Parameter
circle_tantantan_46 = CircleTanTanTan(CurveA=list_item_12, CurveB=circle_tantantan_45, CurveC=list_item_9, Point=evaluate_length_46.Point)
evaluate_length_47 = EvaluateLength(Curve=circle_tantantan_46, Length=0.75, Normalized=True)  # -> Point, Tangent, Parameter
circle_tantantan_47 = CircleTanTanTan(CurveA=list_item_12, CurveB=circle_tantantan_46, CurveC=list_item_9, Point=evaluate_length_47.Point)
evaluate_length_48 = EvaluateLength(Curve=circle_tantantan_47, Length=0.75, Normalized=True)  # -> Point, Tangent, Parameter
circle_tantantan_48 = CircleTanTanTan(CurveA=list_item_12, CurveB=circle_tantantan_47, CurveC=list_item_9, Point=evaluate_length_48.Point)
evaluate_length_49 = EvaluateLength(Curve=circle_tantantan_48, Length=0.75, Normalized=True)  # -> Point, Tangent, Parameter
circle_tantantan_49 = CircleTanTanTan(CurveA=list_item_12, CurveB=circle_tantantan_48, CurveC=list_item_9, Point=evaluate_length_49.Point)
evaluate_length_50 = EvaluateLength(Curve=circle_tantantan_49, Length=0.75, Normalized=True)  # -> Point, Tangent, Parameter
circle_tantantan_50 = CircleTanTanTan(CurveA=list_item_12, CurveB=circle_tantantan_49, CurveC=list_item_9, Point=evaluate_length_50.Point)
evaluate_length_51 = EvaluateLength(Curve=circle_tantantan_50, Length=0.75, Normalized=True)  # -> Point, Tangent, Parameter
circle_tantantan_51 = CircleTanTanTan(CurveA=list_item_12, CurveB=circle_tantantan_50, CurveC=list_item_9, Point=evaluate_length_51.Point)
evaluate_length_52 = EvaluateLength(Curve=circle_tantantan_51, Length=0.75, Normalized=True)  # -> Point, Tangent, Parameter
circle_tantantan_52 = CircleTanTanTan(CurveA=list_item_12, CurveB=circle_tantantan_51, CurveC=list_item_9, Point=evaluate_length_52.Point)
evaluate_length_53 = EvaluateLength(Curve=circle_tantantan_52, Length=0.75, Normalized=True)  # -> Point, Tangent, Parameter
circle_tantantan_53 = CircleTanTanTan(CurveA=list_item_12, CurveB=circle_tantantan_52, CurveC=list_item_9, Point=evaluate_length_53.Point)
evaluate_length_54 = EvaluateLength(Curve=circle_tantantan_53, Length=0.75, Normalized=True)  # -> Point, Tangent, Parameter
circle_tantantan_54 = CircleTanTanTan(CurveA=list_item_12, CurveB=circle_tantantan_53, CurveC=list_item_9, Point=evaluate_length_54.Point)
evaluate_length_55 = EvaluateLength(Curve=circle_tantantan_54, Length=0.75, Normalized=True)  # -> Point, Tangent, Parameter
circle_tantantan_55 = CircleTanTanTan(CurveA=list_item_12, CurveB=circle_tantantan_54, CurveC=list_item_9, Point=evaluate_length_55.Point)
evaluate_length_56 = EvaluateLength(Curve=circle_tantantan_55, Length=0.75, Normalized=True)  # -> Point, Tangent, Parameter
circle_tantantan_56 = CircleTanTanTan(CurveA=list_item_12, CurveB=circle_tantantan_55, CurveC=list_item_9, Point=evaluate_length_56.Point)
evaluate_length_57 = EvaluateLength(Curve=circle_tantantan_56, Length=0.75, Normalized=True)  # -> Point, Tangent, Parameter
evaluate_length_58 = EvaluateLength(Curve=circle_tantantan_56, Length=0.75, Normalized=True)  # -> Point, Tangent, Parameter
circle_tantantan_57 = CircleTanTanTan(CurveA=list_item_12, CurveB=circle_tantantan_56, CurveC=list_item_9, Point=evaluate_length_57.Point)
circle_tantantan_58 = CircleTanTanTan(CurveA=list_item_12, CurveB=circle_tantantan_56, CurveC=list_item_9, Point=evaluate_length_58.Point)
evaluate_length_59 = EvaluateLength(Curve=circle_tantantan_58, Length=0.75, Normalized=True)  # -> Point, Tangent, Parameter
circle_tantantan_59 = CircleTanTanTan(CurveA=list_item_12, CurveB=circle_tantantan_58, CurveC=list_item_9, Point=evaluate_length_59.Point)
evaluate_length_60 = EvaluateLength(Curve=circle_tantantan_59, Length=0.75, Normalized=True)  # -> Point, Tangent, Parameter
circle_tantantan_60 = CircleTanTanTan(CurveA=list_item_12, CurveB=circle_tantantan_59, CurveC=list_item_9, Point=evaluate_length_60.Point)
evaluate_length_61 = EvaluateLength(Curve=circle_tantantan_60, Length=0.75, Normalized=True)  # -> Point, Tangent, Parameter
circle_tantantan_61 = CircleTanTanTan(CurveA=list_item_12, CurveB=circle_tantantan_60, CurveC=list_item_9, Point=evaluate_length_61.Point)
evaluate_length_62 = EvaluateLength(Curve=circle_tantantan_61, Length=0.75, Normalized=True)  # -> Point, Tangent, Parameter
circle_tantantan_62 = CircleTanTanTan(CurveA=list_item_12, CurveB=circle_tantantan_61, CurveC=list_item_9, Point=evaluate_length_62.Point)
evaluate_length_63 = EvaluateLength(Curve=circle_tantantan_62, Length=0.75, Normalized=True)  # -> Point, Tangent, Parameter
circle_tantantan_63 = CircleTanTanTan(CurveA=list_item_12, CurveB=circle_tantantan_62, CurveC=list_item_9, Point=evaluate_length_63.Point)
evaluate_length_64 = EvaluateLength(Curve=circle_tantantan_63, Length=0.75, Normalized=True)  # -> Point, Tangent, Parameter
circle_tantantan_64 = CircleTanTanTan(CurveA=list_item_12, CurveB=circle_tantantan_63, CurveC=list_item_9, Point=evaluate_length_64.Point)
evaluate_length_65 = EvaluateLength(Curve=circle_tantantan_64, Length=0.75, Normalized=True)  # -> Point, Tangent, Parameter
circle_tantantan_65 = CircleTanTanTan(CurveA=list_item_12, CurveB=circle_tantantan_64, CurveC=list_item_9, Point=evaluate_length_65.Point)
evaluate_length_66 = EvaluateLength(Curve=circle_tantantan_65, Length=0.75, Normalized=True)  # -> Point, Tangent, Parameter
circle_tantantan_66 = CircleTanTanTan(CurveA=list_item_12, CurveB=circle_tantantan_65, CurveC=list_item_9, Point=evaluate_length_66.Point)
evaluate_length_67 = EvaluateLength(Curve=circle_tantantan_66, Length=0.75, Normalized=True)  # -> Point, Tangent, Parameter
circle_tantantan_67 = CircleTanTanTan(CurveA=list_item_12, CurveB=circle_tantantan_66, CurveC=list_item_9, Point=evaluate_length_67.Point)
evaluate_length_68 = EvaluateLength(Curve=circle_tantantan_67, Length=0.75, Normalized=True)  # -> Point, Tangent, Parameter
circle_tantantan_68 = CircleTanTanTan(CurveA=list_item_12, CurveB=circle_tantantan_67, CurveC=list_item_9, Point=evaluate_length_68.Point)
evaluate_length_69 = EvaluateLength(Curve=circle_tantantan_68, Length=0.75, Normalized=True)  # -> Point, Tangent, Parameter
circle_tantantan_69 = CircleTanTanTan(CurveA=list_item_12, CurveB=circle_tantantan_68, CurveC=list_item_9, Point=evaluate_length_69.Point)
evaluate_length_70 = EvaluateLength(Curve=circle_tantantan_69, Length=0.75, Normalized=True)  # -> Point, Tangent, Parameter
circle_tantantan_70 = CircleTanTanTan(CurveA=list_item_12, CurveB=circle_tantantan_69, CurveC=list_item_9, Point=evaluate_length_70.Point)
evaluate_length_71 = EvaluateLength(Curve=circle_tantantan_70, Length=0.75, Normalized=True)  # -> Point, Tangent, Parameter
circle_tantantan_71 = CircleTanTanTan(CurveA=list_item_12, CurveB=circle_tantantan_70, CurveC=list_item_9, Point=evaluate_length_71.Point)
evaluate_length_72 = EvaluateLength(Curve=circle_tantantan_71, Length=0.75, Normalized=True)  # -> Point, Tangent, Parameter
evaluate_length_73 = EvaluateLength(Curve=circle_tantantan_71, Length=0.75, Normalized=True)  # -> Point, Tangent, Parameter
circle_tantantan_72 = CircleTanTanTan(CurveA=list_item_12, CurveB=circle_tantantan_71, CurveC=list_item_9, Point=evaluate_length_72.Point)
circle_tantantan_73 = CircleTanTanTan(CurveA=list_item_12, CurveB=circle_tantantan_71, CurveC=list_item_9, Point=evaluate_length_73.Point)
evaluate_length_74 = EvaluateLength(Curve=circle_tantantan_73, Length=0.75, Normalized=True)  # -> Point, Tangent, Parameter
circle_tantantan_74 = CircleTanTanTan(CurveA=list_item_12, CurveB=circle_tantantan_73, CurveC=list_item_9, Point=evaluate_length_74.Point)
evaluate_length_75 = EvaluateLength(Curve=circle_tantantan_74, Length=0.75, Normalized=True)  # -> Point, Tangent, Parameter
circle_tantantan_75 = CircleTanTanTan(CurveA=list_item_12, CurveB=circle_tantantan_74, CurveC=list_item_9, Point=evaluate_length_75.Point)
evaluate_length_76 = EvaluateLength(Curve=circle_tantantan_75, Length=0.75, Normalized=True)  # -> Point, Tangent, Parameter
circle_tantantan_76 = CircleTanTanTan(CurveA=list_item_12, CurveB=circle_tantantan_75, CurveC=list_item_9, Point=evaluate_length_76.Point)
evaluate_length_77 = EvaluateLength(Curve=circle_tantantan_76, Length=0.75, Normalized=True)  # -> Point, Tangent, Parameter
circle_tantantan_77 = CircleTanTanTan(CurveA=list_item_12, CurveB=circle_tantantan_76, CurveC=list_item_9, Point=evaluate_length_77.Point)
evaluate_length_78 = EvaluateLength(Curve=circle_tantantan_77, Length=0.75, Normalized=True)  # -> Point, Tangent, Parameter
circle_tantantan_78 = CircleTanTanTan(CurveA=list_item_12, CurveB=circle_tantantan_77, CurveC=list_item_9, Point=evaluate_length_78.Point)
evaluate_length_79 = EvaluateLength(Curve=circle_tantantan_78, Length=0.75, Normalized=True)  # -> Point, Tangent, Parameter
circle_tantantan_79 = CircleTanTanTan(CurveA=list_item_12, CurveB=circle_tantantan_78, CurveC=list_item_9, Point=evaluate_length_79.Point)
evaluate_length_80 = EvaluateLength(Curve=circle_tantantan_79, Length=0.75, Normalized=True)  # -> Point, Tangent, Parameter
circle_tantantan_80 = CircleTanTanTan(CurveA=list_item_12, CurveB=circle_tantantan_79, CurveC=list_item_9, Point=evaluate_length_80.Point)
power = Power(A="2", B="-12")
plane = Plane(PlaneYZ(0, 0, 0))
rotate = Rotate(Geometry=plane, Angle=degrees(-45), Plane=PlaneXY(0, 0, 0))  # -> Geometry, Transform
power_2 = Power(A="3", B="6")
scale = Scale(Geometry=merge, Center=Point(0, 0, 0), Factor=power_2)  # -> Geometry, Transform
multiplication = Multiplication(A=".5", B=power_2)
möbius_transformation = MöbiusTransformation(Geometry=graft(scale.Geometry), Circle=flatten(scale.Geometry), T=pi, Q=0, FixSphere=False)  # disabled
list_item_14 = ListItem(List=möbius_transformation, Index=[0, -1, -2, -3, -4], Wrap=True)
cull_index_3 = CullIndex(List=möbius_transformation, Indices=0, Wrap=True)
geometry_2 = Geometry(flatten(möbius_transformation))
evaluate_length_81 = EvaluateLength(Curve=geometry_2, Length=0, Normalized=True)  # -> Point, Tangent, Parameter
to_polar = ToPolar(Point=evaluate_length_81.Point, System=PlaneXY(0, 0, 0))  # -> Phi, Theta, Radius
smaller_than = SmallerThan(FirstNumber=to_polar.Radius, SecondNumber=multiplication)  # -> SmallerThan, OrEqualTo
cull_pattern = CullPattern(List=geometry_2, CullPattern=smaller_than.SmallerThan)
geometry_3 = Geometry(cull_pattern)
multiplication_2 = Multiplication(A=".5", B=power_2)
scale_2 = Scale(Geometry=merge_3, Center=Point(0, 0, 0), Factor=power_2)  # -> Geometry, Transform
möbius_transformation_2 = MöbiusTransformation(Geometry=graft(möbius_transformation), Circle=flatten(scale_2.Geometry), T=pi, Q=0, FixSphere=False)  # disabled
geometry_4 = Geometry(flatten(möbius_transformation_2))
evaluate_length_82 = EvaluateLength(Curve=geometry_4, Length=0, Normalized=True)  # -> Point, Tangent, Parameter
to_polar_2 = ToPolar(Point=evaluate_length_82.Point, System=PlaneXY(0, 0, 0))  # -> Phi, Theta, Radius
smaller_than_2 = SmallerThan(FirstNumber=to_polar_2.Radius, SecondNumber=multiplication_2)  # -> SmallerThan, OrEqualTo
cull_pattern_2 = CullPattern(List=geometry_4, CullPattern=smaller_than_2.SmallerThan)
geometry_5 = Geometry(cull_pattern_2)
möbius_transformation_3 = MöbiusTransformation(Geometry=graft(möbius_transformation_2), Circle=flatten(scale_2.Geometry), T=pi, Q=0, FixSphere=False)  # disabled
scale_3 = Scale(Geometry=geometry_3, Center=Point(0, 0, 0), Factor=expr("1/X", power_2))  # -> Geometry, Transform
möbius_transformation_4 = MöbiusTransformation(Geometry=graft(möbius_transformation_3), Circle=flatten(scale_2.Geometry), T=pi, Q=0, FixSphere=False)  # disabled
curve_display = CurveDisplay(Curves=scale_3.Geometry, Thickness=2, Color=RGB(255, 0, 255))
merge_4 = Merge(
    Data1=circle_tantantan,
    Data2=circle_tantantan_2,
    Data3=circle_tantantan_3,
    Data4=circle_tantantan_4,
    Data5=circle_tantantan_5,
    Data6=circle_tantantan_6,
    Data7=circle_tantantan_7,
    Data8=circle_tantantan_8,
    Data9=circle_tantantan_9,
    Data10=circle_tantantan_10,
    Data11=circle_tantantan_11,
    Data12=circle_tantantan_12,
    Data13=circle_tantantan_13,
    Data14=circle_tantantan_14,
    Data15=circle_tantantan_15,
    Data16=circle_tantantan_16,
    Data17=circle_tantantan_17,
    Data18=circle_tantantan_18,
    Data19=circle_tantantan_19,
    Data20=circle_tantantan_20,
    Data21=circle_tantantan_21,
    Data22=circle_tantantan_22,
    Data23=circle_tantantan_23,
    Data24=circle_tantantan_24,
    Data25=circle_tantantan_25,
    Data26=circle_tantantan_26,
    Data27=circle_tantantan_27,
    Data28=circle_tantantan_28,
    Data29=circle_tantantan_29,
    Data30=circle_tantantan_30,
    Data31=circle_tantantan_31,
    Data32=circle_tantantan_32,
    Data33=circle_tantantan_33,
    Data34=circle_tantantan_34,
    Data35=circle_tantantan_35,
    Data36=circle_tantantan_36,
    Data37=circle_tantantan_37,
    Data38=circle_tantantan_38,
    Data39=circle_tantantan_39,
    Data40=circle_tantantan_40,
    Data41=circle_tantantan_41,
    Data42=circle_tantantan_42,
    Data43=circle_tantantan_43,
    Data44=circle_tantantan_44,
    Data45=circle_tantantan_45,
    Data46=circle_tantantan_46,
    Data47=circle_tantantan_47,
    Data48=circle_tantantan_48,
    Data49=circle_tantantan_49,
    Data50=circle_tantantan_50,
    Data51=circle_tantantan_51,
    Data52=circle_tantantan_52,
    Data53=circle_tantantan_53,
    Data54=circle_tantantan_54,
    Data55=circle_tantantan_55,
    Data56=circle_tantantan_56,
    Data57=circle_tantantan_57,
    Data58=circle_tantantan_58,
    Data59=circle_tantantan_59,
    Data60=circle_tantantan_60,
    Data61=circle_tantantan_61,
    Data62=circle_tantantan_62,
    Data63=circle_tantantan_63,
    Data64=circle_tantantan_64,
    Data65=circle_tantantan_65,
    Data66=circle_tantantan_66,
    Data67=circle_tantantan_67,
    Data68=circle_tantantan_68,
    Data69=circle_tantantan_69,
    Data70=circle_tantantan_70,
    Data71=circle_tantantan_71,
    Data72=circle_tantantan_72,
    Data73=circle_tantantan_73,
    Data74=circle_tantantan_74,
    Data75=circle_tantantan_75,
    Data76=circle_tantantan_76,
    Data77=circle_tantantan_77,
    Data78=circle_tantantan_78,
    Data79=circle_tantantan_79,
    Data80=circle_tantantan_80)
möbius_transformation_5 = MöbiusTransformation(Geometry=graft(möbius_transformation_4), Circle=flatten(scale_2.Geometry), T=pi, Q=0, FixSphere=False)  # disabled
scale_4 = Scale(Geometry=möbius_transformation, Center=Point(0, 0, 0), Factor=expr("1/X", power_2))  # -> Geometry, Transform
mirror = Mirror(Geometry=merge_4, Plane=rotate.Geometry)  # -> Geometry, Transform
value_list = ValueList({"AngularDimension", "Arc", "Block", "Brep", "Circle", "Curve", "Dimension", "Ellipse", "Extrusion", "Hatch", "Leader", "Line", "LinearDimension", "Mesh", "Point", "Polyline", "Polysurface", "RadialDimension", "Surface", "Text", "TextDot"}, selected="Circle")
subtraction = Subtraction(A="81", B="2")
list_item_15 = ListItem(List=scale_4.Geometry, Index=1, Wrap=True)
merge_5 = Merge(Data1=merge_4, Data2=mirror.Geometry)
polar_array = PolarArray(Geometry=merge_5, Plane=PlaneXY(0, 0, 0), Count=4, Angle=degrees(360))  # -> Geometry, Transform
merge_6 = Merge(Data1=merge, Data2=polar_array.Geometry)  # -> flatten(Result)
clean_tree = CleanTree(RemoveNulls=True, RemoveInvalid=True, RemoveEmpty=False, Tree=merge_6)
evaluate_length_83 = EvaluateLength(Curve=clean_tree, Length=graft([0.25, 0.75]), Normalized=True)  # -> Point, Tangent, Parameter
flip_matrix_4 = FlipMatrix(Data=evaluate_length_83.Point)
polyline = PolyLine(Vertices=flip_matrix_4, Closed=False)
evaluate_length_84 = EvaluateLength(Curve=clean_tree, Length=graft([0, 0.5]), Normalized=True)  # -> Point, Tangent, Parameter
flip_matrix_5 = FlipMatrix(Data=evaluate_length_84.Point)
polyline_2 = PolyLine(Vertices=flip_matrix_5, Closed=False)
rebuild_curve = RebuildCurve(Curve=polyline, Count=digit_scroller_2, Tangents=False)
rebuild_curve_2 = RebuildCurve(Curve=polyline_2, Count=digit_scroller_2, Tangents=False)
list_item_16 = ListItem(List=clean_tree, Index=digit_scroller_3, Wrap=False)
cull_index_4 = CullIndex(List=clean_tree, Indices=[3, 4], Wrap=False)
curve_display_2 = CurveDisplay(Curves=list_item_16)
list_item_17 = ListItem(List=clean_tree, Index=[0, 1, 2, 5, 6, 10, 17, 21, 22, 23, 24, 25], Wrap=False)
weave = Weave(Pattern=[0, 1, 2], Stream0=rebuild_curve, Stream1=rebuild_curve_2, Stream2=clean_tree, NullGaps=False)
point_in_curves = PointInCurves(Point=clean_tree, Curves=rectangle.Rectangle)  # -> Relationship, Index, Point
larger_than = LargerThan(FirstNumber=point_in_curves.Relationship, SecondNumber=1)  # -> LargerThan, OrEqualTo
list_item_18 = ListItem(List=clean_tree, Index=-3, Wrap=True)
cull_pattern_3 = CullPattern(List=clean_tree, CullPattern=larger_than.OrEqualTo)
merge_7 = Merge(Data2=cull_pattern_3, Data3=list_item_18)
möbius_transformation_6 = MöbiusTransformation(Geometry=graft(merge_7), Circle=flatten(list_item_13), T=pi, Q=0, FixSphere=False)
möbius_transformation_7 = MöbiusTransformation(Geometry=graft(möbius_transformation_6), Circle=flatten(möbius_transformation_6), T=pi, Q=0, FixSphere=False)  # disabled
möbius_transformation_8 = MöbiusTransformation(Geometry=graft(möbius_transformation_6), Circle=flatten(list_item_13), T=pi, Q=0, FixSphere=False)  # disabled
polar_array_2 = PolarArray(Geometry=möbius_transformation_8, Plane=PlaneXY(0, 0, 0), Count=4, Angle=6.283185307)  # -> Geometry, Transform; disabled
power_3 = Power(A="3", B="9")
scale_5 = Scale(Geometry=möbius_transformation_7, Center=Point(0, 0, 0), Factor=power_3)  # -> Geometry, Transform
möbius_transformation_9 = MöbiusTransformation(Geometry=graft(scale_5.Geometry), Circle=flatten(scale_5.Geometry), T=pi, Q=0, FixSphere=False)  # disabled
scale_6 = Scale(Geometry=möbius_transformation_6, Center=Point(0, 0, 0), Factor=power_3)  # -> Geometry, Transform
scale_7 = Scale(Geometry=möbius_transformation_9, Center=Point(0, 0, 0), Factor=expr("1/X", power_3))  # -> Geometry, Transform
fast_loop_start = FastLoopStart(Iterations=subtraction, Data=scale_6.Geometry)  # -> port, Counter, Data
addition = Addition(A=fast_loop_start.Counter, B="0")
geometry_6 = Geometry(fast_loop_start.Data)
filter_by_type = FilterByType(ObjectType=value_list, Geometry=geometry_6, invertFilter=False, returnNulls=False)  # -> ExcludedGeometry, IncludedGeometry
list_item_19 = ListItem(List=flatten(list_item_15), Index=0, Wrap=True)
möbius_transformation_10 = MöbiusTransformation(Geometry=graft(list_item_15), Circle=flatten(list_item_19), T=pi, Q=0, FixSphere=False)
circle = Circle(filter_by_type.IncludedGeometry)
modulus = Modulus(A=addition, B="2")
list_item_20 = ListItem(List=flatten(möbius_transformation_10), Index=5, Wrap=True)
addition_2 = Addition(A=modulus, B="0")
list_item_21 = ListItem(List=flatten(circle), Index=addition_2, Wrap=False)  # -> Item, Item1, Item2, Item3, Item4, Item5
merge_8 = Merge(
    Data1=list_item_21.Item,
    Data3=list_item_21.Item2,
    Data4=list_item_21.Item3,
    Data5=list_item_21.Item4,
    Data6=list_item_21.Item5)  # disabled
möbius_transformation_11 = MöbiusTransformation(Geometry=graft(möbius_transformation_10), Circle=flatten(list_item_20), T=pi, Q=0, FixSphere=False)
möbius_transformation_12 = MöbiusTransformation(Geometry=graft(geometry_6), Circle=flatten(list_item_21.Item), T=pi, Q=0, FixSphere=False)  # -> flatten(Geometry)
geometry_7 = Geometry(list_item_21.Item)
fast_loop_end = FastLoopEnd(port=fast_loop_start.port, Exit=False, Data=möbius_transformation_12, RecordData=True, TimeOutVal=0)
scale_8 = Scale(Geometry=fast_loop_end, Center=Point(0, 0, 0), Factor=expr("1/X", power_3))  # -> Geometry, Transform
merge_9 = Merge(Data1=möbius_transformation_6, Data2=scale_8.Geometry)
geometry_8 = Geometry(flatten(merge_9))
curve_closest_point = CurveClosestPoint(Point=Point(0.5, 0, 0), Curve=geometry_8)  # -> Point, Parameter, Distance
cull_duplicates = CullDuplicates(Points=curve_closest_point.Point, Tolerance=1.164153218e-10, CullMode=1)  # -> Points, Indices, Valence
list_item_22 = ListItem(List=geometry_8, Index=cull_duplicates.Indices, Wrap=False)
cull_index_5 = CullIndex(List=list_item_22, Indices=0, Wrap=True)
polar_array_3 = PolarArray(Geometry=cull_index_5, Plane=PlaneXY(0, 0, 0), Count=4, Angle=6.283185307)  # -> Geometry, Transform

geometry_9 = Geometry(list_item_5)
geometry_10 = Geometry(polar_array_3.Geometry)
geometry_11 = Geometry(list_item_8)
geometry_12 = Geometry(polar_array.Geometry)
merge_10 = Merge(Data1=geometry_9, Data2=geometry_10, Data3=geometry_11, Data4=geometry_12)
