# Grasshopper definition XHG.TЯPDLƧ.⠀ⵙᙁⵙᗩⵙ✤ⵙᑐᑕⵙᗩⵙᴥⵙꗳⵙ⠀◯⠀ⵙᑐᑕⵙꖴⵙᴥⵙ✤ⵙИNⵙᗱᗴⵙᑐᑕⵙИNⵙⓄⵙᑐᑕⵙ⠀◯⠀ⵙᔓᔕⵙᑎⵙИNⵙᗱᗴⵙᕤᕦⵙ⠀◯⠀ⵙᙁⵙᗩⵙᴥⵙᗝⵙᗱᗴⵙ옷ⵙᗩⵙ✤ⵙᑐᑕⵙⓄⵙ⠀⊚⠀ⵙ◌ⵙ⠀⊚⠀ⵙ◌ⵙ⠀⊚⠀ⵙ◌ⵙ⠀⚪⠀ⵙ⠀◯⠀ⵙ⠀◯⠀ⵙ⠀⚪⠀ⵙ◌ⵙ⠀⊚⠀ⵙ◌ⵙ⠀⊚⠀ⵙ◌ⵙ⠀⊚⠀ⵙⓄⵙᑐᑕⵙ✤ⵙᗩⵙ옷ⵙᗱᗴⵙᗝⵙᴥⵙᗩⵙᙁⵙ⠀◯⠀ⵙᕤᕦⵙᗱᗴⵙИNⵙᑎⵙᔓᔕⵙ⠀◯⠀ⵙᑐᑕⵙⓄⵙИNⵙᑐᑕⵙᗱᗴⵙИNⵙ✤ⵙᴥⵙꖴⵙᑐᑕⵙ⠀◯⠀ⵙꗳⵙᴥⵙᗩⵙᑐᑕⵙ✤ⵙᗩⵙᙁⵙ⠀.SLDPRT.GHX (Grasshopper 1.0.7)
# plug-ins: Pancake, Shader Nodes, Element, Weaverbird

panel = Panel("1/7257.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")
geometry = Geometry([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])
weaverbird_s_catmull_clark_subdivision = WeaverbirdsCatmullClarkSubdivision(Level=3, SmoothNakedEdges=2)  # disabled
deconstruct_mesh = DeconstructMesh(Mesh=weaverbird_s_catmull_clark_subdivision)  # -> Vertices, Faces, Colours, Normals; disabled
digit_scroller = DigitScroller(Scroller_Digits=12, Scroller_Prefix="Digit Scroller", Scroller_Radix=11, Scroller_Value=13)
digit_scroller_2 = DigitScroller(Scroller_Digits=12, Scroller_Prefix="Digit Scroller", Scroller_Radix=11, Scroller_Value=1)
import_from = ImportFrom(
    File="C:\O\O_AIDIW_O_WIDIA_O\O_SKROWDILOS_O_SOLIDWORKS_O\ⵙ△ⵙᔓᔕᑎИNᗱᗴᕤᕦⵙᙁᗩᴥᗝᗱᗴ옷ᗩ✤ᑐᑕⓄ⊚◌⊚◌⊚◌⚪ⵙ◯ⵙ◯ⵙ⚪◌⊚◌⊚◌⊚Ⓞᑐᑕ✤ᗩ옷ᗱᗴᗝᴥᗩᙁⵙᕤᕦᗱᗴИNᑎᔓᔕⵙ△ⵙ\TЯPDLƧ.ⵙᙁᗩ✤ᑐᑕᗩᴥꗳⵙᑐᑕꖴᴥ✤ИNᗱᗴᑐᑕИNⓄᑐᑕⵙᔓᔕᑎИNᗱᗴᕤᕦⵙᙁᗩᴥᗝᗱᗴ옷ᗩ✤ᑐᑕⓄ⊚◌⊚◌⊚◌⚪ⵙ◯ⵙ◯ⵙ⚪◌⊚◌⊚◌⊚Ⓞᑐᑕ✤ᗩ옷ᗱᗴᗝᴥᗩᙁⵙᕤᕦᗱᗴИNᑎᔓᔕⵙᑐᑕⓄИNᑐᑕᗱᗴИN✤ᴥꖴᑐᑕⵙꗳᴥᗩᑐᑕ✤ᗩᙁⵙ.SLDPRT",
    LastSaveLocalization="neutral,N")  # -> Geo, Layer, ObjectAttributes; disabled
_4444 = Number([6, 10, 11, 12, 7, 2, 9, 14])
_4444_2 = Number([3, 8, 5, 1])
_4444_3 = Number([0, 4])
_4444_4 = Number(13)
list_item = ListItem(List=geometry, Index=_4444, Wrap=False)
geometry_2 = Geometry(list_item)
deconstruct_brep = DeconstructBrep(Brep=geometry_2)  # -> Faces, Edges, Vertices; disabled
evaluate_surface = EvaluateSurface(Surface=deconstruct_brep.Faces, Point=deconstruct_mesh.Vertices)  # -> Point, Normal, UDirection, VDirection, Frame; disabled
pull_point = PullPoint(Point=deconstruct_mesh.Vertices, Geometry=geometry_2, ClosestOnly=False)  # -> flatten(ClosestPoint), Distance; disabled
deconstruct_vector = DeconstructVector(Vector=evaluate_surface.Normal)  # -> XComponent, YComponent, ZComponent
construct_mesh = ConstructMesh(Vertices=pull_point.ClosestPoint, Faces=deconstruct_mesh.Faces)  # disabled
plane_surface = PlaneSurface(Plane=PlaneXY(0, 0, 0), XSize=Domain(-10, 10), YSize=Domain(-10, 10))
plane_surface_2 = PlaneSurface(Plane=PlaneYZ(0, 0, 0), XSize=Domain(-10, 10), YSize=Domain(-10, 10))
plane_surface_3 = PlaneSurface(Plane=Plane(origin=(0, 0, 0), x=(0, 0, 1), y=(1, 0, 0)), XSize=Domain(-10, 10), YSize=Domain(-10, 10))
subtraction = Subtraction(A=0, B=deconstruct_vector.XComponent)
subtraction_2 = Subtraction(A=0, B=deconstruct_vector.YComponent)
subtraction_3 = Subtraction(A=0, B=deconstruct_vector.ZComponent)
digit_scroller_3 = DigitScroller(Scroller_Digits=12, Scroller_Prefix="Digit Scroller", Scroller_Radix=11, Scroller_Value=135)
digit_scroller_4 = DigitScroller(Scroller_Digits=12, Scroller_Prefix="Digit Scroller", Scroller_Radix=11, Scroller_Value=130)
digit_scroller_5 = DigitScroller(Scroller_Digits=12, Scroller_Prefix="Digit Scroller", Scroller_Radix=11, Scroller_Value=3)
digit_scroller_6 = DigitScroller(Scroller_Digits=12, Scroller_Prefix="Digit Scroller", Scroller_Radix=11, Scroller_Value=0)
vector_xyz = VectorXYZ(XComponent=subtraction, YComponent=subtraction_2, ZComponent=subtraction_3)  # -> Vector, Length
project_point = ProjectPoint(Point=deconstruct_mesh.Vertices, Direction=vector_xyz.Vector, Geometry=geometry_2)  # -> Point, Index; disabled
clean_tree = CleanTree(RemoveNulls=True, RemoveInvalid=True, RemoveEmpty=False, Tree=project_point.Point)
geometry_3 = Geometry(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)
split_brep = SplitBrep(Brep=geometry_3, Cutter=plane_surface_3)  # -> flatten(Result)
split_brep_2 = SplitBrep(Brep=split_brep, Cutter=plane_surface_2)  # -> flatten(Result)
split_brep_3 = SplitBrep(Brep=split_brep_2, Cutter=plane_surface)  # -> flatten(Result)
list_item_2 = ListItem(List=split_brep_3, Index=Slider(5, range=0..7), Wrap=False)
digit_scroller_7 = DigitScroller(Scroller_Digits=12, Scroller_Prefix="Digit Scroller", Scroller_Radix=11, Scroller_Value=2)
geometry_4 = Geometry(geometry_2)
flatten_tree = FlattenTree(Tree=geometry_3, Path="{0}")
panel_2 = Panel(flatten_tree)
quadrangulate = Quadrangulate(Mesh=geometry_4, Angle=360, Ratio=0)  # -> Mesh, Count
brep_edges = BrepEdges(Brep=geometry_4)  # -> Naked, Interior, NonManifold
number_slider = Slider(9, range=0..100)
digit_scroller_8 = DigitScroller(Scroller_Digits=12, Scroller_Prefix="Digit Scroller", Scroller_Radix=1, Scroller_Value=0.5)
digit_scroller_9 = DigitScroller(Scroller_Digits=12, Scroller_Prefix="Digit Scroller", Scroller_Radix=1, Scroller_Value=0.5)
list_item_3 = ListItem(List=flatten_tree, Index=[digit_scroller_5, digit_scroller_3, digit_scroller_6], Wrap=False)  # disabled
weaverbird_s_catmull_clark_subdivision_2 = WeaverbirdsCatmullClarkSubdivision(MeshCurves=quadrangulate.Mesh, Level=1, SmoothNakedEdges=2)  # -> flatten(OutputMeshCurves)
curve = Curve(brep_edges.Naked)
explode = Explode(Curve=curve, Recursive=True)  # -> flatten(Segments), flatten(Vertices)
cull_duplicates = CullDuplicates(Points=explode.Vertices, Tolerance=1.525878906e-05, CullMode=1)  # -> Points, Indices, Valence
list_item_4 = ListItem(List=cull_duplicates.Points, Index=[0, 1], Wrap=False)
list_item_5 = ListItem(List=cull_duplicates.Points, Index=[1, 2], Wrap=False)
list_item_6 = ListItem(List=cull_duplicates.Points, Index=0, Wrap=False)
scale = Scale(Geometry=list_item_5, Center=list_item_6, Factor=1.525878906e-05)  # -> Geometry, Transform
merge = Merge(Data1=reverse(list_item_5), Data2=scale.Geometry)
list_item_7 = ListItem(List=cull_duplicates.Points, Index=digit_scroller_2, Wrap=False)
list_item_8 = ListItem(List=explode.Segments, Index=[2, 3], Wrap=True)
curve_middle = CurveMiddle(Curve=list_item_8)
merge_2 = Merge(Data1=flatten(curve_middle), Data2=flatten(list_item_4))
construct_mesh_2 = ConstructMesh(Vertices=merge_2, Faces={A=0, B=1, C=2, D=3})
digit_scroller_10 = DigitScroller(Scroller_Digits=12, Scroller_Prefix="Digit Scroller", Scroller_Radix=1, Scroller_Value=0.5)
element_octahedron = ElementOctahedron(Radius=0.7071067812)  # -> Polylines, OctahedronMesh
element_octahedron_2 = ElementOctahedron(Radius=0.13267342)  # -> Polylines, OctahedronMesh
panel_3 = Panel("-2.53125")
curve_2 = Curve(brep_edges.Interior)
number_slider_2 = Slider(0, range=0..16384)
digit_scroller_11 = DigitScroller(Scroller_Digits=12, Scroller_Prefix="Digit Scroller", Scroller_Radix=11, Scroller_Value=16384)

digit_scroller_12 = DigitScroller(Scroller_Digits=12, Scroller_Prefix="Digit Scroller", Scroller_Radix=2, Scroller_Value=-4)
digit_scroller_13 = DigitScroller(Scroller_Digits=12, Scroller_Prefix="Digit Scroller", Scroller_Radix=3, Scroller_Value=8)
power = Power(A=9, B=digit_scroller_12)
multiplication = Multiplication(A="1.40625", B=digit_scroller_13)
multiplication_2 = Multiplication(A=power, B="7257.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")
panel_4 = Panel("0")
settings_custom = SettingsCustom(
    StitchSeams=True,
    SimplePlanes=True,
    Refine=True,
    MinCount=digit_scroller_11,
    MaxCount=0,
    AspectRatio=Slider(0, range=0..256),
    MaxDistance=0,
    MaxAngle=0,
    MinEdge=0,
    MaxEdge=0)
panel_5 = Panel("1.40625*2")

mesh_brep = MeshBrep(Brep=geometry_4, Settings=settings_custom)
scale_2 = Scale(Geometry=mesh_brep, Center=Point(0, 0, 0), Factor=panel)  # -> Geometry, Transform
panel_6 = Panel(scale_2.Geometry)
deconstruct_mesh_2 = DeconstructMesh(Mesh=scale_2.Geometry)  # -> Vertices, Faces, Colours, Normals
list_length = ListLength(List=deconstruct_mesh_2.Faces)
multiplication_3 = Multiplication(A=list_length, B=194)  # disabled
quad_remesh_settings = QuadRemeshSettings(TargetCount=8192, AdaptiveSize=100, AdaptiveCount=True, HardEdges=True, SeamEdges=1, Symmetry=0, GuideCurves=2)
mesh_join = MeshJoin(Meshes=flatten(scale_2.Geometry))
panel_7 = Panel(mesh_join)
quad_remesh = QuadRemesh(Mesh=geometry_4, Settings=quad_remesh_settings)  # disabled
scale_3 = Scale(Geometry=quad_remesh, Center=Point(0, 0, 0), Factor=panel)  # -> Geometry, Transform
panel_8 = Panel(multiplication_3)
panel_9 = Panel(list_length)
true_only_button = TrueOnlyButton(LastSaveLocalization="neutral,N")
simple_mesh = SimpleMesh(Brep=geometry_2)  # disabled
scale_4 = Scale(Geometry=simple_mesh, Center=Point(0, 0, 0), Factor=panel)  # -> Geometry, Transform; disabled
pa = Pa(
    G0=element_octahedron.OctahedronMesh,
    G1=element_octahedron_2.OctahedronMesh,
    T0=digit_scroller_10,
    T1=digit_scroller_10,
    D=digit_scroller_10,
    C=True,
    R=True)  # -> out, A; inputs G0: GeometryBase, G1: GeometryBase, I: list, T0: list, T1: list, clr: list of Color; disabled
# ---------- pa: VB usings ----------
Imports System.IO
Imports System.Linq
Imports System.Data
Imports System.Drawing
Imports System.Reflection
Imports System.Windows.Forms
Imports System.Xml
Imports System.Xml.Linq
Imports Microsoft.VisualBasic
Imports System.Runtime.InteropServices

Imports Rhino.DocObjects
Imports Rhino.Collections
Imports GH_IO
Imports GH_IO.Serialization
# ---------- pa: VB ----------
    Component.Params.Input(0).Name = "Mesh or Curve"
    Component.Params.Input(0).Description = "Open or closed mesh or curve"
    Component.Params.Input(1).Name = "Mesh or Curve"
    Component.Params.Input(1).Description = "Optional open or closed mesh or curve whose type should correspond to G0."
    Component.Params.Input(2).Name = "Index [Face]"
    Component.Params.Input(2).Description = "An optional integer or list of integers which specify the faces to be modified if the input is a mesh. If no value is supplied then all faces will be modified"
    Component.Params.Input(3).Name = "Vert to Face [Vertex]"
    Component.Params.Input(3).Description = "Evaluates a new vertex between the input geometry's vertex to the face center"
    Component.Params.Input(4).Name = "Vert to Vol [Vertex]"
    Component.Params.Input(4).Description = "Evaluates a new vertex between the input geometry's vertex to the volumetric center"
    Component.Params.Input(5).Name = "Distance"
    Component.Params.Input(5).Description = "An optional number to add depth if no input is provided for G1"
    Component.Params.Input(6).Name = "Close"
    Component.Params.Input(6).Description = "If true then additional faces and if needed vertices will be added to the mesh, closing the solid"
    Component.Params.Input(7).Name = "Invert"
    Component.Params.Input(7).Description = "If true the faces the close the mesh are reversed, flipping the solid/ void relationship"
    Component.Params.Input(8).Name = "Color [Vertex]"
    Component.Params.Input(8).Description = "(If applied to a mesh a list of colors corresponding to each mesh face, if applied to a curve, a list of colors corresponding to each control point plus an additonal color value for the new averaged center"

    Component.Params.Output(1).Name = "Mesh"
    Component.Params.Output(1).Description = "If successful, a valid mesh"

    If G0 IsNot Nothing Then

      Dim bG,bM, bP,bmC,biC,O As Boolean
      O = True

      bM = G0.ObjectType = ObjectType.Mesh
      bP = G0.ObjectType = ObjectType.Curve

      bG = (bM Or bP)
      If G1 IsNot Nothing Then
        If bM And G1.ObjectType <> ObjectType.Mesh Then bG = False
        If bP And G1.ObjectType <> ObjectType.Curve Then bG = False
      End If

      If bG Then
        Dim msh,msha,mshe As New mesh
        Dim crv,crva As curve
        Dim av(2) As point3d
        Dim ac(2),ax(1)  As color
        Dim h,j,jj,k,u,v,ua,ub,va,vb,w As Integer
        Dim cv,cf,ce,dcv As Integer
        Dim x(),y() As Integer

        Dim mv,fv,ep,tv As New list(Of Point3d)
        Dim mev As New dictionary(Of String, Integer)
        Dim mf As Rhino.Geometry.Collections.MeshFaceList = Nothing
        Dim mtv As Rhino.Geometry.Collections.MeshTopologyVertexList = Nothing
        Dim mte As Rhino.Geometry.Collections.MeshTopologyEdgeList = Nothing
        Dim ev As New list(Of vector3d)
        Dim ed As New list(Of Double)
        Dim en As New list(Of Boolean)
        Dim mc,ec,tc,cc,fc As New list(Of color)
        Dim xf As New list(Of meshface)

        If clr.count() = 0 Then clr.add(color.LightGray) Else biC = True

        If bm Then
          'Start Deconstruct if Mesh
          msh = G0

          mshe = msh.Duplicate()
          mte = mshe.TopologyEdges()
          mtv = mshe.TopologyVertices()
          mf = mshe.Faces()

          If G1 IsNot Nothing Then
            msha = G1

            If msh.Vertices.Count() <> msha.vertices.count() Then Exit Sub
          Else
            msha = msh.Offset(-d)
          End If

          msh.Append(msha)

          If i.count() = 0 Then I = Enumerable.Range(0, mf.Count()).ToList()

          mv = msh.Vertices().ToPoint3dArray().tolist()

          cf = I.Count() - 1

          'Assign Colors
          If mshe.VertexColors.Count() < 1 Then
            mshe.VertexColors.CreateMonotoneMesh(color.LightGray)
            bmC = biC
          Else
            bmC = True
          End If

          If msha.VertexColors.Count() > 0 Then bmC = True


          mc = mshe.VertexColors().ToArray().ToList()
          If msha.VertexColors.count() < 1 Then mc.addrange(mc) Else mc.addrange(msha.VertexColors().ToArray().ToList())
        Else
          'Start Deconstruct if Curve
          crv = G0

          I.clear()
          I.add(0)
          Dim nc As nurbscurve
          Dim pc As polyline
          Dim nps As Rhino.Geometry.Collections.NurbsCurvePointList

          nc = crv.ToNurbsCurve()
          nps = nc.Points
          pc = nc.Points.ControlPolygon
          If (Not pc.IsClosed) Then pc.add(pc(0))
          av(0) = pc.CenterPoint

          msh.Vertices.AddVertices(pc.ToArray())
          msh.faces.addfaces(pc.TriangulateClosedPolyline())
          msh.Vertices.Remove(pc.count() - 1, True)

          mv = msh.Vertices.ToPoint3dArray().tolist()
          mte = msh.TopologyEdges()
          mtv = msh.TopologyVertices()

          'Assign Colors
          If bic Then bmC = True

          If G1 IsNot Nothing Then
            crva = G1
            nc = crva.ToNurbsCurve()
            nps = nc.Points
            pc = nc.Points.ControlPolygon
            If (Not pc.IsClosed) Then pc.add(pc(0))
            av(1) = pc.CenterPoint
            pc.RemoveAt(pc.count() - 1)

            If pc.count() <> mv.count() Then Exit Sub

            cf = 1
            mv.addrange(pc)
          Else
            Dim tcpt As point3d
            msh.Normals.ComputeNormals()
            msh.Normals.UnitizeNormals()
            k = mv.count()
            For j = 0 To k - 1 Step 1
              mv.add(mv.item(j) + msh.Normals(j) * d)
              tcpt += mv.item(j) + msh.Normals(j) * d
            Next

            av(1) = tcpt / k
          End If

          If (msh.Vertices.count() - 1) > 3 Then o = False
          cf = 0
        End If
        ce = mte.count()
        cv = mv.count() / 2
        dcv = mv.count()

        x = appendprepend(cv - 1)
        'Match variables and colors to vertex count
        If (T0.count()) < cv Then T0 = dblDList(matchDbl(T0, cv)) Else If (T0.count()) = cv Then T0.addrange(T0) Else If (T0.count()) < dcv Then T0 = matchDbl(T0, dcv)
        If (T1.count()) < cv Then T1 = dblDList(matchDbl(T1, cv)) Else If (T1.count()) = cv Then T1.addrange(T1) Else If (T1.count()) < dcv Then T1 = matchDbl(T1, dcv)
        If (clr.count()) < cv Then clr = dblCList(matchClr(clr, cv)) Else If (clr.count()) = cv Then clr.addrange(clr)Else If (clr.count()) < dcv Then clr = matchClr(clr, dcv)

        If bp Then
          mc = clr
          ac = colorCap(mc)
        End If

        If biC Then fc = clr Else fc = mc

        'Edge based vertices
        k = 0
        Dim cpt As point3d
        Dim ccl As color
        Dim bce As Boolean

        For j = 0 To ce - 1 Step 1
          If (bm Or (bp And (mte.GetConnectedFaces(j).Count() < 2))) Then
            ua = mtv.MeshVertexIndices(mte.GetTopologyVertices(j).I)(0)
            va = mtv.MeshVertexIndices(mte.GetTopologyVertices(j).J)(0)

            ub = ua + cv
            vb = va + cv

            cpt = (mv(ua) + mv(va) + mv(ub) + mv(vb)) / 4
            ccl = avg4Clr(mc(ua), mc(va), mc(ub), mc(vb))
            bce = mte.GetConnectedFaces(j).count() <> 2

            ep.add(evalP(mv(ua), cpt, t0(ua)))
            ec.add(evalC(mc(ua), ccl, t0(ua)))
            en.add(bce)
            mev.add(ua & "," & va & "," & 0, k)

            ep.add(evalP(mv(va), cpt, t0(va)))
            ec.add(evalC(mc(va), ccl, t0(va)))
            en.add(bce)
            mev.add(va & "," & ua & "," & 0, k + 1)

            ep.add(evalP(mv(ub), cpt, t0(ub)))
            ec.add(evalC(mc(ub), ccl, t0(ub)))
            en.add(bce)
            mev.add(ub & "," & vb & "," & 0, k + 2)

            ep.add(evalP(mv(vb), cpt, t0(vb)))
            ec.add(evalC(mc(vb), ccl, t0(vb)))
            en.add(bce)
            mev.add(vb & "," & ub & "," & 0, k + 3)

            k += 4
          End If
        Next

        'Face based vertices
        Dim xv(),mt(),ei() As Integer
        Dim xca(),xcb(),xta(),xtb() As color
        Dim xn As Double
        ReDim ei(3)
        u = 4
        v = ep.count()
        If c Then
          If r Then
            v += dcv
          Else
            If (Not o) Then If bm Then v += cf * 2 + 1 Else v += 2
          End If
        End If

        For jj = 0 To I.count() - 1 Step 1
          Dim tcv As New point3d
          j = I(jj)
          w = v + tv.count()
          xn = 0
          If bm Then
            If mf(j).isquad() Then h = 4 Else h = 3
            ReDim xv(h - 1)
            ReDim xca(h - 1)
            ReDim xcb(h - 1)
            ReDim xta(h - 1)
            ReDim xtb(h - 1)
            mt = mf.GetTopologicalVertices(j)
            For k = 0 To h - 1 Step 1
              xv(k) = mtv.MeshVertexIndices(mt(k))(0)
              xca(k) = mc(xv(k))
              xcb(k) = mc(xv(k) + cv)
              xta(k) = clr(xv(k))
              xtb(k) = clr(xv(k) + cv)
            Next
            av(0) = mf.GetFaceCenter(j)
            av(1) = msh.faces.GetFaceCenter(j + cf + 1)
            ac(0) = avgClr(xca)
            ac(1) = avgClr(xcb)
            ax(0) = avgClr(xta)
            ax(1) = avgClr(xtb)
            If biC Then ac(2) = sumC(ax(0), ax(1)) Else ac(2) = sumC(ac(0), ac(1))
          Else
            h = cv
            xv = Enumerable.Range(0, h).ToArray()
          End If

          For k = 0 To h - 1 Step 1
            xn += T1(xv(k))
          Next
          xn /= h

          av(2) = (av(0) + av(1)) / 2
          y = appendprepend(h - 1)

          For k = 1 To h Step 1
            ei(0) = mev.item(xv(y(k)) & "," & xv(y(k + 1)) & "," & 0)
            ei(1) = mev.item(xv(y(k)) + cv & "," & xv(y(k + 1)) + cv & "," & 0)
            ei(2) = mev.item(xv(y(k + 1)) & "," & xv(y(k)) & "," & 0)
            ei(3) = mev.item(xv(y(k + 1)) + cv & "," & xv(y(k)) + cv & "," & 0)

            'Define new per face vertices
            tv.add(evalP(mv(xv(y(k))), av(0), t0(xv(y(k)))))
            tc.add(evalC(mc(xv(y(k))), ac(0), t0(xv(y(k)))))

            tv.add(evalP(mv(xv(y(k)) + cv), av(1), t0(xv(y(k)) + cv)))
            tc.add(evalC(mc(xv(y(k)) + cv), ac(1), t0(xv(y(k)) + cv)))

            tv.add(evalP(mv(xv(y(k))), av(2), t1(xv(y(k)))))
            tc.add(evalC(mc(xv(y(k))), ac(2), t1(xv(y(k)))))

            tv.add(evalP(mv(xv(y(k)) + cv), av(2), t1(xv(y(k)) + cv)))
            tc.add(evalC(mc(xv(y(k)) + cv), ac(2), t1(xv(y(k)) + cv)))

            'Define new faces
            xf.add(New meshface(ei(0), ei(1), w + y(k) * u + 3, w + y(k) * u + 2))
            xf.add(New meshface(ei(3), ei(2), w + y(k + 1) * u + 2, w + y(k + 1) * u + 3))
            xf.add(New meshface(ei(1), ei(3), w + y(k + 1) * u + 3, w + y(k) * u + 3))
            xf.add(New meshface(ei(2), ei(0), w + y(k) * u + 2, w + y(k + 1) * u + 2))
            xf.add(New meshface(w + y(k) * u, w + y(k + 1) * u, w + y(k + 1) * u + 2, w + y(k) * u + 2))
            xf.add(New meshface(w + y(k + 1) * u + 1, w + y(k) * u + 1, w + y(k) * u + 3, w + y(k + 1) * u + 3))

            If c Then
              If r Then
                If en.item(ei(0)) Then
                  xf.add(New meshface(ei(0), ei(2), v + xv(y(k + 1)) - dcv, v + xv(y(k)) - dcv))
                  xf.add(New meshface(ei(3), ei(1), v + xv(y(k)) + cv - dcv, v + xv(y(k + 1)) + cv - dcv))
                  xf.add(New meshface(ei(1), ei(0), v + xv(y(k)) - dcv, v + xv(y(k)) + cv - dcv))
                  xf.add(New meshface(ei(2), ei(3), v + xv(y(k + 1)) + cv - dcv, v + xv(y(k + 1)) - dcv))
                End If
                xf.add(New meshface(w + y(k + 1) * u + 0, w + y(k) * u + 0, v + xv(y(k)) - dcv, v + xv(y(k + 1)) - dcv))
                xf.add(New meshface(w + y(k) * u + 1, w + y(k + 1) * u + 1, v + xv(y(k + 1)) + cv - dcv, v + xv(y(k)) + cv - dcv))
              Else
                If en.item(ei(0)) Then xf.add(New meshface(ei(1), ei(0), ei(2), ei(3)))
                If (Not o) Then
                  xf.add(New meshface(w + y(k + 1) * u, w + y(k) * u, v + jj * 2 - cf * 2 - 2))
                  xf.add(New meshface(w + y(k) * u + 1, w + y(k + 1) * u + 1, v + jj * 2 - cf * 2 - 1))
                End If
              End If
            End If
          Next
          If c Then

            If (Not r) Then

              If (Not o) Then
                fv.add(av(0))
                cc.add(ac(0))

                fv.add(av(1))
                cc.add(ac(1))
              Else
                If h = 3 Then
                  xf.add(New meshface(w + 1 * u, w + 0 * u, w + 2 * u))
                  xf.add(New meshface(w + 0 * u + 1, w + 1 * u + 1, w + 2 * u + 1))
                ElseIf h = 4 Then
                  xf.add(New meshface(w + 1 * u, w + 0 * u, w + 3 * u, w + 2 * u))
                  xf.add(New meshface(w + 0 * u + 1, w + 1 * u + 1, w + 2 * u + 1, w + 3 * u + 1))
                End If

              End If

            End If

          End If
        Next

        Dim om As New mesh
        om.Vertices.AddVertices(ep.toarray())
        If bmC Then om.VertexColors.AppendColors(ec.toarray())

        If c Then
          If r Then
            om.Vertices.AddVertices(mv)
            If bmC Then om.VertexColors.AppendColors(mc.toarray())
          Else
            If (Not o) Then
              om.Vertices.AddVertices(fv)
              If bmC Then om.VertexColors.AppendColors(cc.toarray())
            End If
          End If
        End If

        om.Vertices.AddVertices(tv.toarray())
        If bmC Then om.VertexColors.AppendColors(tc.toarray())

        om.Faces.AddFaces(xf.toarray())

        If (c And r) Then om.Flip(True, True, True)

        'If i.count() > 0 Then om.Vertices.CullUnused()

        A = om
      End If
    End If
# ---------- pa: VB additional code ----------
  Private Function appendprepend(ByVal i As Integer)
    Dim srsEnum As IEnumerable(Of Integer) = Enumerable.Range(0, i + 1)
    Dim arrVal As New list(Of Integer)
    arrVal = srsEnum.tolist()
    arrVal.add(0)
    arrVal.insert(0, i)
    Return arrVal.toarray()
  End Function

  Private Function colorCap(ByVal c As list(Of color))
    Dim i,k As Integer
    k = c.count() / 2
    Dim r(2),g(2),b(2) As Integer
    For i = 0 To k - 1 Step 1
      r(0) += c.item(i).R
      r(1) += c.item(i + k).R
      g(0) += c.item(i).g
      g(1) += c.item(i + k).g
      b(0) += c.item(i).b
      b(1) += c.item(i + k).b
    Next

    r(0) = CInt(r(0) / k)
    r(1) = CInt(r(1) / k)
    g(0) = CInt(g(0) / k)
    g(1) = CInt(g(1) / k)
    b(0) = CInt(b(0) / k)
    b(1) = CInt(b(1) / k)

    r(2) = CInt((r(0) + r(1)) / 2)
    g(2) = CInt((g(0) + g(1)) / 2)
    b(2) = CInt((b(0) + b(1)) / 2)

    If r(0) > 255 Then r(0) = 255 Else If r(0) < 0 Then r(0) = 0
    If r(1) > 255 Then r(1) = 255 Else If r(1) < 0 Then r(1) = 0
    If g(0) > 255 Then g(0) = 255 Else If g(0) < 0 Then g(0) = 0
    If g(1) > 255 Then g(1) = 255 Else If g(1) < 0 Then g(1) = 0
    If b(0) > 255 Then b(0) = 255 Else If b(0) < 0 Then b(0) = 0
    If b(1) > 255 Then b(1) = 255 Else If b(1) < 0 Then b(1) = 0

    If r(2) > 255 Then r(2) = 255 Else If r(2) < 0 Then r(2) = 0
    If g(2) > 255 Then g(2) = 255 Else If g(2) < 0 Then g(2) = 0
    If b(2) > 255 Then b(2) = 255 Else If b(2) < 0 Then b(2) = 0

    Return {color.FromArgb(r(0), G(0), b(0)),color.FromArgb(r(1), G(1), b(1)),color.FromArgb(r(2), G(2), b(2))}
  End Function

  Private Function dblCList(ByVal a As list(Of color))
    a.addrange(a)
    Return a
  End Function

  Private Function dblDList(ByVal a As list(Of Double))
    a.addrange(a)
    Return a
  End Function

  Private Function matchDbl(ByVal a As list(Of Double), ByVal t As Integer)
    Dim i,k As Integer
    k = a.count()
    For i = 0 To ((t + 1) - k) - 1 Step 1
      a.add(a.item(k - 1))
    Next
    Return a
  End Function

  Private Function matchClr(ByVal a As list(Of Color), ByVal t As Integer)
    Dim i,k As Integer
    k = a.count()
    For i = 0 To ((t + 1) - k) - 1 Step 1
      a.add(a.item(k - 1))
    Next
    Return a
  End Function

  Private Function sumC(ByVal ca As Color, ByVal cb As Color)
    Dim r,g,b As Integer

    r = CInt((CInt(ca.R) + CInt(cb.R)) / 2)
    g = CInt((CInt(ca.g) + CInt(cb.g)) / 2)
    b = CInt((CInt(ca.b) + CInt(cb.b)) / 2)

    If r > 255 Then r = 255 Else If r < 0 Then r = 0
    If G > 255 Then G = 255 Else If G < 0 Then G = 0
    If b > 255 Then b = 255 Else If b < 0 Then b = 0

    Return color.FromArgb(r, G, b)
  End Function

  Private Function avg4Clr(ByVal ca As Color, ByVal cb As Color, ByVal cc As Color, ByVal cd As Color)
    Dim r,g,b As Integer

    r = CInt((CInt(ca.R) + CInt(cb.R) + CInt(cc.R) + CInt(cd.R)) / 4)
    g = CInt((CInt(ca.g) + CInt(cb.g) + CInt(cc.g) + CInt(cd.g)) / 4)
    b = CInt((CInt(ca.b) + CInt(cb.b) + CInt(cc.b) + CInt(cd.b)) / 4)

    If r > 255 Then r = 255 Else If r < 0 Then r = 0
    If G > 255 Then G = 255 Else If G < 0 Then G = 0
    If b > 255 Then b = 255 Else If b < 0 Then b = 0

    Return color.FromArgb(r, G, b)
  End Function

  Private Function evalP(ByVal op As point3d, ByVal tp As Point3d, ByVal t As Double)
    Return New point3d(op + (tp - op) * t)
  End Function

  Private Function evalV(ByVal ov As vector3d, ByVal tv As vector3d, ByVal t As Double)
    Return New vector3d(ov + (tv - ov) * t)
  End Function

  Private Function evalN(ByVal u As Double, ByVal v As Double, ByVal t As Double)
    Return u + (v - u) * t
  End Function

  Private Function avgVec(ByVal v() As vector3f)
    Dim i As Integer
    Dim tv As Vector3d

    For i = 0 To ubound(v) Step 1
      tv += v(i)
    Next
    tv /= (ubound(v) + 1)
    tv.Unitize()
    Return New vector3f(tv.X, tv.Y, tv.Z)
  End Function

  Private Function roundClr(ByVal r As Integer, ByVal G As Integer, ByVal b As Integer, ByVal i As Integer)
    r = CInt(r / i)
    G = CInt(G / i)
    b = CInt(b / i)

    If r > 255 Then r = 255 Else If r < 0 Then r = 0
    If G > 255 Then G = 255 Else If G < 0 Then G = 0
    If b > 255 Then b = 255 Else If b < 0 Then b = 0

    Return color.FromArgb(r, G, b)
  End Function

  Private Function avgClr(ByVal c() As color)
    Dim r,G,b As Integer
    Dim i,k As Integer

    k = ubound(c) + 1

    For i = 0 To k - 1 Step 1
      r += CInt(c(i).R)
      G += CInt(c(i).G)
      b += CInt(c(i).B)
    Next

    r = CInt(r / k)
    G = CInt(G / k)
    b = CInt(b / k)

    If r > 255 Then r = 255 Else If r < 0 Then r = 0
    If G > 255 Then G = 255 Else If G < 0 Then G = 0
    If b > 255 Then b = 255 Else If b < 0 Then b = 0

    Return color.FromArgb(r, G, b)
  End Function

  Private Function evalC(ByVal oc As color, ByVal tc As color, ByVal t As Double)
    Dim r,G,b As Integer
    r = CInt(CInt(oc.R) + (CInt(tc.R) - CInt(oc.R)) * t)
    G = CInt(CInt(oc.G) + (CInt(tc.G) - CInt(oc.G)) * t)
    b = CInt(CInt(oc.B) + (CInt(tc.B) - CInt(oc.B)) * t)

    If r > 255 Then r = 255 Else If r < 0 Then r = 0
    If G > 255 Then G = 255 Else If G < 0 Then G = 0
    If b > 255 Then b = 255 Else If b < 0 Then b = 0

    Return color.FromArgb(r, G, b)
  End Function
# ---------- end pa ----------
boolean_toggle = BooleanToggle(True)
scale_5 = Scale(Geometry=weaverbird_s_catmull_clark_subdivision_2, Center=Point(0, 0, 0), Factor=panel)  # -> Geometry, Transform
P = P(
    G0=element_octahedron.OctahedronMesh,
    G1=element_octahedron_2.OctahedronMesh,
    T0=digit_scroller_10,
    T1=digit_scroller_10,
    T2=digit_scroller_10,
    T3=digit_scroller_10,
    D=digit_scroller_10,
    C=True,
    R=True)  # -> out, A; inputs G0: GeometryBase, G1: GeometryBase, I: list, T0: list, T1: list, T2: list, T3: list, clr: list of Color; disabled
# ---------- P: VB ----------
    Component.Params.Input(0).Name = "Mesh or Curve"
    Component.Params.Input(0).Description = "Open or closed mesh or curve"
    Component.Params.Input(1).Name = "Mesh or Curve"
    Component.Params.Input(1).Description = "Optional open or closed mesh or curve whose type should correspond to G0."
    Component.Params.Input(2).Name = "Index [Face]"
    Component.Params.Input(2).Description = "An optional integer or list of integers which specify the faces to be modified if the input is a mesh. If no value is supplied then all faces will be modified"
    Component.Params.Input(3).Name = "Vert to Face [Vertex]"
    Component.Params.Input(3).Description = "Evaluates a new vertex between the input geometry's vertex to the face center"
    Component.Params.Input(4).Name = "Edge to Face [Vertex]"
    Component.Params.Input(4).Description = "Evaluates a new vertex between the input geometry's edge midpoint to the face center"
    Component.Params.Input(5).Name = "Vert to Vol [Vertex]"
    Component.Params.Input(5).Description = "Evaluates a new vertex between the input geometry's vertex to the volumetric center"
    Component.Params.Input(6).Name = "Edge to Vol [Vertex]"
    Component.Params.Input(6).Description = "Evaluates a new vertex between the input geometry's edge midpoint to the face center"
    Component.Params.Input(7).Name = "Distance"
    Component.Params.Input(7).Description = "An optional number to add depth if no input is provided for G1"
    Component.Params.Input(8).Name = "Close"
    Component.Params.Input(8).Description = "If true then additional faces and if needed vertices will be added to the mesh, closing the solid"
    Component.Params.Input(9).Name = "Invert"
    Component.Params.Input(9).Description = "If true the faces the close the mesh are reversed, flipping the solid/ void relationship"
    Component.Params.Input(10).Name = "Color [Vertex]"
    Component.Params.Input(10).Description = "(If applied to a mesh a list of colors corresponding to each mesh face, if applied to a curve, a list of colors corresponding to each control point plus an additonal color value for the new averaged center"

    Component.Params.Output(1).Name = "Mesh"
    Component.Params.Output(1).Description = "If successful, a valid mesh"

    If G0 IsNot Nothing Then

      Dim bG,bM, bP,bmC,biC As Boolean

      bM = G0.ObjectType = ObjectType.Mesh
      bP = G0.ObjectType = ObjectType.Curve

      bG = (bM Or bP)
      If G1 IsNot Nothing Then
        If bM And G1.ObjectType <> ObjectType.Mesh Then bG = False
        If bP And G1.ObjectType <> ObjectType.Curve Then bG = False
      End If

      If bG Then
        Dim msh,msha,mshe As New mesh
        Dim crv,crva As curve
        Dim av(2) As point3d
        Dim ac(2),ax(1) As color
        Dim h,j,jj,k,u,v,ua,ub,va,vb,w As Integer
        Dim cv,cf,ce,dcv As Integer
        Dim x(),y() As Integer
        Dim bnk() As Boolean = Nothing

        Dim mv,fv,ep,tv,ecv,np As New list(Of Point3d)
        Dim mev,mvv As New dictionary(Of String, Integer)
        Dim mf As Rhino.Geometry.Collections.MeshFaceList = Nothing
        Dim mtv As Rhino.Geometry.Collections.MeshTopologyVertexList = Nothing
        Dim mte As Rhino.Geometry.Collections.MeshTopologyEdgeList = Nothing
        Dim ev As New list(Of vector3d)
        Dim ed As New list(Of Double)
        Dim en As New list(Of Boolean)
        Dim mc,ec,tc,cc,fc,ecc,nc As New list(Of color)
        Dim xf As New list(Of meshface)

        If clr.count() = 0 Then clr.add(color.LightGray) Else biC = True

        If bm Then
          'Start Deconstruct if Mesh
          msh = G0

          mshe = msh.Duplicate()
          mte = mshe.TopologyEdges()
          mtv = mshe.TopologyVertices()
          mf = mshe.Faces()

          bnk = mshe.GetNakedEdgePointStatus()

          If G1 IsNot Nothing Then
            msha = G1

            If msh.Vertices.Count() <> msha.vertices.count() Then Exit Sub
          Else
            msha = msh.Offset(-d)
          End If

          msh.Append(msha)

          If i.count() = 0 Then I = Enumerable.Range(0, mf.Count()).ToList()

          mv = msh.Vertices().ToPoint3dArray().tolist()

          cf = I.Count()

          'Assign Colors
          If mshe.VertexColors.Count() < 1 Then
            mshe.VertexColors.CreateMonotoneMesh(color.LightGray)
            bmC = biC
          Else
            bmC = True
          End If

          If msha.VertexColors.Count() > 0 Then bmC = True

          mc = mshe.VertexColors().ToArray().ToList()
          If msha.VertexColors.count() < 1 Then mc.addrange(mc) Else mc.addrange(msha.VertexColors().ToArray().ToList())

        Else
          'Start Deconstruct if Curve
          crv = G0

          I.clear()
          I.add(0)
          Dim nbc As nurbscurve
          Dim pc As polyline
          Dim nps As Rhino.Geometry.Collections.NurbsCurvePointList

          nbc = crv.ToNurbsCurve()
          nps = nbc.Points
          pc = nbc.Points.ControlPolygon
          If (Not pc.IsClosed) Then pc.add(pc(0))
          av(0) = pc.CenterPoint

          msh.Vertices.AddVertices(pc.ToArray())
          msh.faces.addfaces(pc.TriangulateClosedPolyline())
          msh.Vertices.Remove(pc.count() - 1, True)

          mv = msh.Vertices.ToPoint3dArray().tolist()
          mte = msh.TopologyEdges()
          mtv = msh.TopologyVertices()

          If (c And r) Then
            ReDim bnk(mv.count() - 1)
            For j = 0 To mv.count() - 1 Step 1
              bnk(j) = True
            Next
          End If

          'Assign Colors
          If bic Then bmC = True

          If G1 IsNot Nothing Then
            crva = G1
            nbc = crva.ToNurbsCurve()
            nps = nbc.Points
            pc = nbc.Points.ControlPolygon
            If (Not pc.IsClosed) Then pc.add(pc(0))
            av(1) = pc.CenterPoint
            pc.RemoveAt(pc.count() - 1)

            If pc.count() <> mv.count() Then Exit Sub

            cf = 1
            mv.addrange(pc)
          Else
            Dim tcpt As point3d
            msh.Normals.ComputeNormals()
            msh.Normals.UnitizeNormals()
            k = mv.count()
            For j = 0 To k - 1 Step 1
              mv.add(mv.item(j) + msh.Normals(j) * d)
              tcpt += mv.item(j) + msh.Normals(j) * d
            Next

            cf = 1
            av(1) = tcpt / k
          End If

        End If
        ce = mte.count()
        cv = mv.count() / 2
        dcv = mv.count()

        x = appendprepend(cv - 1)
        'Match variables and colors to vertex count
        If (T0.count()) < cv Then T0 = dblDList(matchDbl(T0, cv)) Else If (T0.count()) = cv Then T0.addrange(T0) Else If (T0.count()) < dcv Then T0 = matchDbl(T0, dcv)
        If (T1.count()) < cv Then T1 = dblDList(matchDbl(T1, cv)) Else If (T1.count()) = cv Then T1.addrange(T1) Else If (T1.count()) < dcv Then T1 = matchDbl(T1, dcv)
        If (T2.count()) < cv Then T2 = dblDList(matchDbl(T2, cv)) Else If (T2.count()) = cv Then T2.addrange(T2) Else If (T2.count()) < dcv Then T2 = matchDbl(T2, dcv)
        If (T3.count()) < cv Then T3 = dblDList(matchDbl(T3, cv)) Else If (T3.count()) = cv Then T3.addrange(T3) Else If (T3.count()) < dcv Then T3 = matchDbl(T3, dcv)
        If (clr.count()) < cv Then clr = dblCList(matchClr(clr, cv)) Else If (clr.count()) = cv Then clr.addrange(clr)Else If (clr.count()) < dcv Then clr = matchClr(clr, dcv)

        If bp Then
          mc = clr
          ac = colorCap(mc)
        End If

        'Edge based vertices
        k = 0
        Dim cpt As point3d
        Dim ccl As color
        Dim bce As Boolean

        jj = 0
        For j = 0 To ce - 1 Step 1
          If (bm Or (bp And (mte.GetConnectedFaces(j).Count() < 2))) Then
            ua = mtv.MeshVertexIndices(mte.GetTopologyVertices(j).I)(0)
            va = mtv.MeshVertexIndices(mte.GetTopologyVertices(j).J)(0)

            ub = ua + cv
            vb = va + cv

            cpt = (mv(ua) + mv(va) + mv(ub) + mv(vb)) / 4
            ccl = avg4Clr(mc(ua), mc(va), mc(ub), mc(vb))
            bce = mte.GetConnectedFaces(j).count() <> 2

            If c Then
              If r Then
                ecv.add(evalP(mv(ua), mv(va), 0.5))
                ecc.add(evalC(mc(ua), mc(va), 0.5))
                mev.add(ua & "," & va & "," & 3, jj)
                mev.add(va & "," & ua & "," & 3, jj)

                ecv.add(evalP(mv(ub), mv(vb), 0.5))
                ecc.add(evalC(mc(ub), mc(vb), 0.5))
                mev.add(ub & "," & vb & "," & 3, jj + 1)
                mev.add(vb & "," & ub & "," & 3, jj + 1)
                jj += 2
              Else
                If bce Then
                  ecv.add(cpt)
                  ecc.add(ccl)
                  mev.add(ua & "," & va & "," & 3, jj)
                  mev.add(va & "," & ua & "," & 3, jj)
                  jj += 1
                End If
              End If
            End If

            ep.add(evalP(mv(ua), cpt, t0(ua)))
            ec.add(evalC(mc(ua), ccl, t0(ua)))
            en.add(bce)
            mev.add(ua & "," & va & "," & 0, k)

            ep.add(evalP(mv(va), cpt, t0(va)))
            ec.add(evalC(mc(va), ccl, t0(va)))
            en.add(bce)
            mev.add(va & "," & ua & "," & 0, k + 1)

            ep.add(evalP(mv(ub), cpt, t0(ub)))
            ec.add(evalC(mc(ub), ccl, t0(ub)))
            en.add(bce)
            mev.add(ub & "," & vb & "," & 0, k + 2)

            ep.add(evalP(mv(vb), cpt, t0(vb)))
            ec.add(evalC(mc(vb), ccl, t0(vb)))
            en.add(bce)
            mev.add(vb & "," & ub & "," & 0, k + 3)

            ep.add(evalP((mv(ua) + mv(ub)) / 2, cpt, (t1(ua) + t1(ub)) / 2))
            ec.add(evalC(evalC(mc(ua), mc(ub), 0.5), ccl, (t1(ua) + t1(ub)) / 2))
            en.add(bce)
            mev.add(ua & "," & va & "," & 1, k + 4)
            mev.add(ub & "," & vb & "," & 1, k + 4)

            ep.add(evalP((mv(va) + mv(vb)) / 2, cpt, (t1(va) + t1(vb)) / 2))
            ec.add(evalC(evalC(mc(va), mc(vb), 0.5), ccl, (t1(va) + t1(vb)) / 2))
            en.add(bce)
            mev.add(va & "," & ua & "," & 1, k + 5)
            mev.add(vb & "," & ub & "," & 1, k + 5)

            ep.add(evalP((mv(ua) + mv(va)) / 2, cpt, (t1(ua) + t1(va)) / 2))
            ec.add(evalC(evalC(mc(ua), mc(va), 0.5), ccl, (t1(ua) + t1(va)) / 2))
            en.add(bce)
            mev.add(ua & "," & va & "," & 2, k + 6)
            mev.add(va & "," & ua & "," & 2, k + 6)

            ep.add(evalP((mv(ub) + mv(vb)) / 2, cpt, (t1(ub) + t1(vb)) / 2))
            ec.add(evalC(evalC(mc(ub), mc(vb), 0.5), ccl, (t1(ub) + t1(vb)) / 2))
            en.add(bce)
            mev.add(ub & "," & vb & "," & 2, k + 7)
            mev.add(vb & "," & ub & "," & 2, k + 7)

            k += 8
          End If
        Next

        If (c And r) Then
          k = 0
          For j = 0 To ubound(bnk) Step 1
            If bnk(j) Then
              np.add((mv(j) + mv(j + cv)) / 2)
              nc.add(evalC(mc(j), mc(j + cv), 0.5))
              mvv.add(j & "," & j + cv & "," & 0, k)
              k += 1
            End If
          Next
        End If

        'Face based vertices
        Dim xv(),mt(),ei(),xi() As Integer
        Dim xca(),xcb(),xta(),xtb() As color
        Dim xn As Double
        ReDim ei(9)
        ReDim xi(1)
        u = 9
        v = ep.count()
        If c Then
          If r Then
            v += ecv.count() + np.count() + mv.count()
          Else
            v += cf * 2 + ecv.count()
          End If
        End If

        For jj = 0 To I.count() - 1 Step 1
          Dim tcv As New point3d
          j = I(jj)
          w = v + tv.count()
          xn = 0
          If bm Then
            If mf(j).isquad() Then h = 4 Else h = 3
            ReDim xv(h - 1)
            ReDim xca(h - 1)
            ReDim xcb(h - 1)
            ReDim xta(h - 1)
            ReDim xtb(h - 1)
            mt = mf.GetTopologicalVertices(j)
            For k = 0 To h - 1 Step 1
              xv(k) = mtv.MeshVertexIndices(mt(k))(0)
              xca(k) = mc(xv(k))
              xcb(k) = mc(xv(k) + cv)
              xta(k) = clr(xv(k))
              xtb(k) = clr(xv(k) + cv)
            Next
            av(0) = mf.GetFaceCenter(j)
            av(1) = msh.faces.GetFaceCenter(j + cf)
            ac(0) = avgClr(xca)
            ac(1) = avgClr(xcb)
            ax(0) = avgClr(xta)
            ax(1) = avgClr(xtb)
            If biC Then ac(2) = sumC(ax(0), ax(1)) Else ac(2) = sumC(ac(0), ac(1))
          Else
            h = cv
            xv = Enumerable.Range(0, h).ToArray()
          End If
          For k = 0 To h - 1 Step 1
            xn += T1(xv(k))
          Next
          xn /= h
          av(2) = (av(0) + av(1)) / 2
          y = appendprepend(h - 1)

          For k = 1 To h Step 1
            ei(0) = mev.item(xv(y(k)) & "," & xv(y(k + 1)) & "," & 0)
            ei(1) = mev.item(xv(y(k)) + cv & "," & xv(y(k + 1)) + cv & "," & 0)
            ei(2) = mev.item(xv(y(k + 1)) & "," & xv(y(k)) & "," & 0)
            ei(3) = mev.item(xv(y(k + 1)) + cv & "," & xv(y(k)) + cv & "," & 0)
            ei(4) = mev.item(xv(y(k)) & "," & xv(y(k + 1)) & "," & 1)
            ei(5) = mev.item(xv(y(k + 1)) & "," & xv(y(k)) & "," & 1)
            ei(6) = mev.item(xv(y(k)) & "," & xv(y(k + 1)) & "," & 2)
            ei(7) = mev.item(xv(y(k + 1)) + cv & "," & xv(y(k)) + cv & "," & 2)

            'Define new per face vertices
            tv.add(evalP(mv(xv(y(k))), av(0), t0(xv(y(k)))))
            tc.add(evalC(mc(xv(y(k))), ac(0), t0(xv(y(k)))))

            tv.add(evalP(mv(xv(y(k)) + cv), av(1), t0(xv(y(k)) + cv)))
            tc.add(evalC(mc(xv(y(k)) + cv), ac(1), t0(xv(y(k)) + cv)))

            tv.add(evalP(mv(xv(y(k))), av(2), t2(xv(y(k)))))
            tc.add(evalC(mc(xv(y(k))), ac(2), t2(xv(y(k)))))

            tv.add(evalP(mv(xv(y(k)) + cv), av(2), t2(xv(y(k)) + cv)))
            tc.add(evalC(mc(xv(y(k)) + cv), ac(2), t2(xv(y(k)) + cv)))

            tv.add(evalP((mv(xv(y(k))) + mv(xv(y(k + 1)))) / 2, av(0), (t1(xv(y(k))) + t1(xv(y(k + 1)))) / 2))
            tc.add(evalC(evalC(mc(xv(y(k))), mc(xv(y(k + 1))), 0.5), ac(0), (t1(xv(y(k))) + t1(xv(y(k + 1)))) / 2))

            tv.add(evalP((mv(xv(y(k)) + cv) + mv(xv(y(k + 1)) + cv)) / 2, av(1), (t1(xv(y(k)) + cv) + t1(xv(y(k + 1)) + cv)) / 2))
            tc.add(evalC(evalC(mc(xv(y(k)) + cv), mc(xv(y(k + 1)) + cv), 0.5), ac(1), (t1(xv(y(k)) + cv) + t1(xv(y(k + 1)) + cv)) / 2))

            tv.add(evalP((mv(xv(y(k))) + mv(xv(y(k + 1)))) / 2, (av(0) + av(1)) / 2, (t3(xv(y(k))) + t3(xv(y(k + 1)))) / 2))
            tc.add(evalC(evalC(mc(xv(y(k))), mc(xv(y(k + 1))), 0.5), sumC(ac(0), ac(1)), (t3(xv(y(k))) + t3(xv(y(k + 1)))) / 2))

            tv.add(evalP((mv(xv(y(k)) + cv) + mv(xv(y(k + 1)) + cv)) / 2, av(2), (t3(xv(y(k)) + cv) + t3(xv(y(k + 1)) + cv)) / 2))
            tc.add(evalC(evalC(mc(xv(y(k)) + cv), mc(xv(y(k + 1)) + cv), 0.5), ac(2), (t3(xv(y(k)) + cv) + t3(xv(y(k + 1)) + cv)) / 2))

            tv.add(evalP((mv(xv(y(k))) + mv(xv(y(k)) + cv)) / 2, av(2), (t3(xv(y(k))) + t3(xv(y(k)) + cv)) / 2))
            tc.add(evalC(evalC(mc(xv(y(k))), mc(xv(y(k)) + cv), 0.5), ac(2), (t3(xv(y(k))) + t3(xv(y(k)) + cv)) / 2))

            'Define new faces
            xf.add(New meshface(ei(4), ei(1), w + y(k) * u + 3, w + y(k) * u + 8))
            xf.add(New meshface(ei(0), ei(4), w + y(k) * u + 8, w + y(k) * u + 2))

            xf.add(New meshface(ei(3), ei(5), w + y(k + 1) * u + 8, w + y(k + 1) * u + 3))
            xf.add(New meshface(ei(5), ei(2), w + y(k + 1) * u + 2, w + y(k + 1) * u + 8))

            xf.add(New meshface(ei(1), ei(7), w + y(k) * u + 7, w + y(k) * u + 3))
            xf.add(New meshface(ei(7), ei(3), w + y(k + 1) * u + 3, w + y(k) * u + 7))

            xf.add(New meshface(ei(6), ei(0), w + y(k) * u + 2, w + y(k) * u + 6))
            xf.add(New meshface(ei(2), ei(6), w + y(k) * u + 6, w + y(k + 1) * u + 2))

            xf.add(New meshface(w + y(k) * u, w + y(k) * u + 4, w + y(k) * u + 6, w + y(k) * u + 2))
            xf.add(New meshface(w + y(k) * u + 4, w + y(k + 1) * u, w + y(k + 1) * u + 2, w + y(k) * u + 6))

            xf.add(New meshface(w + y(k) * u + 5, w + y(k) * u + 1, w + y(k) * u + 3, w + y(k) * u + 7))
            xf.add(New meshface(w + y(k + 1) * u + 1, w + y(k) * u + 5, w + y(k) * u + 7, w + y(k + 1) * u + 3))

            If c Then
              If r Then
                ei(8) = mev.item(xv(y(k)) & "," & xv(y(k + 1)) & "," & 3)
                ei(9) = mev.item(xv(y(k)) + cv & "," & xv(y(k + 1)) + cv & "," & 3)

                xf.add(New meshface(w + y(k) * u + 4, w + y(k) * u + 0, v - mv.count() + xv(y(k)), ep.count() + ei(8)))
                xf.add(New meshface(w + y(k + 1) * u + 0, w + y(k) * u + 4, ep.count() + ei(8), v - mv.count() + xv(y(k + 1))))

                xf.add(New meshface(w + y(k) * u + 1, w + y(k) * u + 5, ep.count() + ei(9), v - mv.count() + xv(y(k)) + cv))
                xf.add(New meshface(w + y(k) * u + 5, w + y(k + 1) * u + 1, v - mv.count() + xv(y(k + 1)) + cv, ep.count() + ei(9)))
                If en.item(ei(0)) Then
                  xi(0) = mvv.item(xv(y(k)) & "," & xv(y(k)) + cv & "," & 0)
                  xi(1) = mvv.item(xv(y(k + 1)) & "," & xv(y(k + 1)) + cv & "," & 0)

                  xf.add(New meshface(ei(0), ei(6), ep.count() + ei(8), v - mv.count() + xv(y(k))))
                  xf.add(New meshface(ei(6), ei(2), v - mv.count() + xv(y(k + 1)), ep.count() + ei(8)))

                  xf.add(New meshface(ep.count() + ecv.count() + xi(1), v - mv.count() + xv(y(k + 1)), ei(2), ei(5)))
                  xf.add(New meshface(v - mv.count() + xv(y(k + 1)) + cv, ep.count() + ecv.count() + xi(1), ei(5), ei(3)))

                  xf.add(New meshface(ei(7), ei(1), v - mv.count() + xv(y(k)) + cv, ep.count() + ei(9)))
                  xf.add(New meshface(ei(3), ei(7), ep.count() + ei(9), v - mv.count() + xv(y(k + 1)) + cv))

                  xf.add(New meshface(ei(1), ei(4), ep.count() + ecv.count() + xi(0), v - mv.count() + xv(y(k)) + cv))
                  xf.add(New meshface(ei(4), ei(0), v - mv.count() + xv(y(k)), ep.count() + ecv.count() + xi(0)))

                End If
              Else
                xf.add(New meshface(w + y(k) * u + 1, w + y(k) * u + 5, v + jj * 2 - cf * 2 + 1, w + y(k - 1) * u + 5))
                xf.add(New meshface(w + y(k) * u + 4, w + y(k) * u, w + y(k - 1) * u + 4, v + jj * 2 - cf * 2))
                If en.item(ei(0)) Then
                  ei(8) = mev.item(xv(y(k)) & "," & xv(y(k + 1)) & "," & 3)
                  xf.add(New meshface(ei(4), ei(0), ei(6), ep.count() + ei(8)))
                  xf.add(New meshface(ei(2), ei(5), ep.count() + ei(8), ei(6)))
                  xf.add(New meshface(ei(7), ei(1), ei(4), ep.count() + ei(8)))
                  xf.add(New meshface(ei(3), ei(7), ep.count() + ei(8), ei(5)))
                End If
              End If
            End If
          Next
          If c Then
            If (Not r) Then
              fv.add(av(0))
              cc.add(ac(0))

              fv.add(av(1))
              cc.add(ac(1))
            End If
          End If
        Next

        Dim om As New mesh
        om.Vertices.AddVertices(ep.toarray())
        If bmC Then om.VertexColors.AppendColors(ec.toarray())

        If c Then
          om.Vertices.AddVertices(ecv)
          If bmC Then om.VertexColors.AppendColors(ecc.toarray())
          If r Then
            om.Vertices.AddVertices(np)
            If bmC Then om.VertexColors.AppendColors(nc.toarray())
            om.Vertices.AddVertices(mv)
            If bmC Then om.VertexColors.AppendColors(mc.toarray())
          Else
            om.Vertices.AddVertices(fv)
            If bmC Then om.VertexColors.AppendColors(cc.toarray())
          End If
        End If

        om.Vertices.AddVertices(tv.toarray())
        If bmC Then om.VertexColors.AppendColors(tc.toarray())

        om.Faces.AddFaces(xf.toarray())

        If (c And r) Then om.Flip(True, True, True)

        'If i.count() > 0 Then om.Vertices.CullUnused()

        A = om
      End If
    End If
# ---------- P: VB additional code ----------
  Private Function appendprepend(ByVal i As Integer)
    Dim srsEnum As IEnumerable(Of Integer) = Enumerable.Range(0, i + 1)
    Dim arrVal As New list(Of Integer)
    arrVal = srsEnum.tolist()
    arrVal.add(0)
    arrVal.insert(0, i)
    Return arrVal.toarray()
  End Function


  Private Function colorCap(ByVal c As list(Of color))
    Dim i,k As Integer
    k = c.count() / 2
    Dim r(2),g(2),b(2) As Integer
    For i = 0 To k - 1 Step 1
      r(0) += c.item(i).R
      r(1) += c.item(i + k).R
      g(0) += c.item(i).g
      g(1) += c.item(i + k).g
      b(0) += c.item(i).b
      b(1) += c.item(i + k).b
    Next

    r(0) = CInt(r(0) / k)
    r(1) = CInt(r(1) / k)
    g(0) = CInt(g(0) / k)
    g(1) = CInt(g(1) / k)
    b(0) = CInt(b(0) / k)
    b(1) = CInt(b(1) / k)

    r(2) = CInt((r(0) + r(1)) / 2)
    g(2) = CInt((g(0) + g(1)) / 2)
    b(2) = CInt((b(0) + b(1)) / 2)

    If r(0) > 255 Then r(0) = 255 Else If r(0) < 0 Then r(0) = 0
    If r(1) > 255 Then r(1) = 255 Else If r(1) < 0 Then r(1) = 0
    If g(0) > 255 Then g(0) = 255 Else If g(0) < 0 Then g(0) = 0
    If g(1) > 255 Then g(1) = 255 Else If g(1) < 0 Then g(1) = 0
    If b(0) > 255 Then b(0) = 255 Else If b(0) < 0 Then b(0) = 0
    If b(1) > 255 Then b(1) = 255 Else If b(1) < 0 Then b(1) = 0

    If r(2) > 255 Then r(2) = 255 Else If r(2) < 0 Then r(2) = 0
    If g(2) > 255 Then g(2) = 255 Else If g(2) < 0 Then g(2) = 0
    If b(2) > 255 Then b(2) = 255 Else If b(2) < 0 Then b(2) = 0

    Return {color.FromArgb(r(0), G(0), b(0)),color.FromArgb(r(1), G(1), b(1)),color.FromArgb(r(2), G(2), b(2))}
  End Function

  Private Function dblCList(ByVal a As list(Of color))
    a.addrange(a)
    Return a
  End Function

  Private Function dblDList(ByVal a As list(Of Double))
    a.addrange(a)
    Return a
  End Function

  Private Function matchDbl(ByVal a As list(Of Double), ByVal t As Integer)
    Dim i,k As Integer
    k = a.count()
    For i = 0 To ((t + 1) - k) - 1 Step 1
      a.add(a.item(k - 1))
    Next
    Return a
  End Function

  Private Function matchClr(ByVal a As list(Of Color), ByVal t As Integer)
    Dim i,k As Integer
    k = a.count()
    For i = 0 To ((t + 1) - k) - 1 Step 1
      a.add(a.item(k - 1))
    Next
    Return a
  End Function

  Private Function sumC(ByVal ca As Color, ByVal cb As Color)
    Dim r,g,b As Integer

    r = CInt((CInt(ca.R) + CInt(cb.R)) / 2)
    g = CInt((CInt(ca.g) + CInt(cb.g)) / 2)
    b = CInt((CInt(ca.b) + CInt(cb.b)) / 2)

    If r > 255 Then r = 255 Else If r < 0 Then r = 0
    If G > 255 Then G = 255 Else If G < 0 Then G = 0
    If b > 255 Then b = 255 Else If b < 0 Then b = 0

    Return color.FromArgb(r, G, b)
  End Function

  Private Function avg4Clr(ByVal ca As Color, ByVal cb As Color, ByVal cc As Color, ByVal cd As Color)
    Dim r,g,b As Integer

    r = CInt((CInt(ca.R) + CInt(cb.R) + CInt(cc.R) + CInt(cd.R)) / 4)
    g = CInt((CInt(ca.g) + CInt(cb.g) + CInt(cc.g) + CInt(cd.g)) / 4)
    b = CInt((CInt(ca.b) + CInt(cb.b) + CInt(cc.b) + CInt(cd.b)) / 4)

    If r > 255 Then r = 255 Else If r < 0 Then r = 0
    If G > 255 Then G = 255 Else If G < 0 Then G = 0
    If b > 255 Then b = 255 Else If b < 0 Then b = 0

    Return color.FromArgb(r, G, b)
  End Function

  Private Function evalP(ByVal op As point3d, ByVal tp As Point3d, ByVal t As Double)
    Return New point3d(op + (tp - op) * t)
  End Function

  Private Function evalV(ByVal ov As vector3d, ByVal tv As vector3d, ByVal t As Double)
    Return New vector3d(ov + (tv - ov) * t)
  End Function

  Private Function evalN(ByVal u As Double, ByVal v As Double, ByVal t As Double)
    Return u + (v - u) * t
  End Function

  Private Function avgVec(ByVal v() As vector3f)
    Dim i As Integer
    Dim tv As Vector3d

    For i = 0 To ubound(v) Step 1
      tv += v(i)
    Next
    tv /= (ubound(v) + 1)
    tv.Unitize()
    Return New vector3f(tv.X, tv.Y, tv.Z)
  End Function

  Private Function roundClr(ByVal r As Integer, ByVal G As Integer, ByVal b As Integer, ByVal i As Integer)
    r = CInt(r / i)
    G = CInt(G / i)
    b = CInt(b / i)

    If r > 255 Then r = 255 Else If r < 0 Then r = 0
    If G > 255 Then G = 255 Else If G < 0 Then G = 0
    If b > 255 Then b = 255 Else If b < 0 Then b = 0

    Return color.FromArgb(r, G, b)
  End Function

  Private Function avgClr(ByVal c() As color)
    Dim r,G,b As Integer
    Dim i,k As Integer

    k = ubound(c) + 1

    For i = 0 To k - 1 Step 1
      r += CInt(c(i).R)
      G += CInt(c(i).G)
      b += CInt(c(i).B)
    Next

    r = CInt(r / k)
    G = CInt(G / k)
    b = CInt(b / k)

    If r > 255 Then r = 255 Else If r < 0 Then r = 0
    If G > 255 Then G = 255 Else If G < 0 Then G = 0
    If b > 255 Then b = 255 Else If b < 0 Then b = 0

    Return color.FromArgb(r, G, b)
  End Function

  Private Function evalC(ByVal oc As color, ByVal tc As color, ByVal t As Double)
    Dim r,G,b As Integer
    r = CInt(CInt(oc.R) + (CInt(tc.R) - CInt(oc.R)) * t)
    G = CInt(CInt(oc.G) + (CInt(tc.G) - CInt(oc.G)) * t)
    b = CInt(CInt(oc.B) + (CInt(tc.B) - CInt(oc.B)) * t)

    If r > 255 Then r = 255 Else If r < 0 Then r = 0
    If G > 255 Then G = 255 Else If G < 0 Then G = 0
    If b > 255 Then b = 255 Else If b < 0 Then b = 0

    Return color.FromArgb(r, G, b)
  End Function

  ''' <summary>
  ''' This method will be called once every solution, before any calls to RunScript.
  ''' </summary>
  Public Overrides Sub BeforeRunScript()
  End Sub
  ''' <summary>
  ''' This method will be called once every solution, after any calls to RunScript.
  ''' </summary>
  Public Overrides Sub AfterRunScript()
  End Sub
# ---------- end P ----------
mesh_join_2 = MeshJoin(Meshes=scale_3.Geometry)
export_as = ExportAs(
    Geometry=mesh_join,
    FileLocation="C:\JBO.OBJ",
    Overwrite=False,
    Export=true_only_button,
    CompMode=False,
    LastSaveLocalization="neutral,N")  # -> OK, ExportCommand
box = Box(
    G0=element_octahedron.OctahedronMesh,
    G1=element_octahedron_2.OctahedronMesh,
    T0=digit_scroller_10,
    T1=digit_scroller_10,
    D=digit_scroller_10,
    C=False,
    F=False)  # -> out, A; inputs G0: GeometryBase, G1: GeometryBase, I: list, T0: list, T1: list, clr: list of Color; disabled
# ---------- box: VB ----------
    Component.Params.Input(0).Name = "Mesh or Curve"
    Component.Params.Input(0).Description = "Open or closed mesh or curve"
    Component.Params.Input(1).Name = "Mesh or Curve"
    Component.Params.Input(1).Description = "Optional open or closed mesh or curve whose type should correspond to G0."
    Component.Params.Input(2).Name = "Index [Face]"
    Component.Params.Input(2).Description = "An optional integer or list of integers which specify the faces to be modified if the input is a mesh. If no value is supplied then all faces will be modified"
    Component.Params.Input(3).Name = "From Vert [Vertex]"
    Component.Params.Input(3).Description = "Evaluates a new vertex from the input geometry's vertex"
    Component.Params.Input(4).Name = "Transverse [Vertex]"
    Component.Params.Input(4).Description = "Evaluates a new vertex between G0 and G1"
    Component.Params.Input(5).Name = "Distance"
    Component.Params.Input(5).Description = "An optional number to add depth if no input is provided for G1"
    Component.Params.Input(6).Name = "Close"
    Component.Params.Input(6).Description = "If true then additional faces and if needed vertices will be added to the mesh, closing the solid"
    Component.Params.Input(7).Name = "Flip"
    Component.Params.Input(7).Description = "If true, flips the topology"
    Component.Params.Input(8).Name = "Color [Vertex]"
    Component.Params.Input(8).Description = "(If applied to a mesh a list of colors corresponding to each mesh face, if applied to a curve, a list of colors corresponding to each control point plus an additonal color value for the new averaged center"

    Component.Params.Output(1).Name = "Mesh"
    Component.Params.Output(1).Description = "If successful, a valid mesh"

    If G0 IsNot Nothing Then

      Dim bG,bM, bP,bmC,biC As Boolean

      bM = G0.ObjectType = ObjectType.Mesh
      bP = G0.ObjectType = ObjectType.Curve

      bG = (bM Or bP)
      If G1 IsNot Nothing Then
        If bM And G1.ObjectType <> ObjectType.Mesh Then bG = False
        If bP And G1.ObjectType <> ObjectType.Curve Then bG = False
      End If

      If bG Then
        Dim msh,msha,mshe As New mesh
        Dim crv,crva As curve
        Dim av(2) As point3d
        Dim ac(2),ax(1) As color
        Dim h,j,jj,k,u,v,ua,ub,va,vb,w As Integer
        Dim cv,cf,ce,dcv As Integer
        Dim x(),y() As Integer
        Dim bnk() As Boolean = Nothing

        Dim mv,fv,ep,tv,ecv,np As New list(Of Point3d)
        Dim mev,mvv As New dictionary(Of String, Integer)
        Dim mf As Rhino.Geometry.Collections.MeshFaceList = Nothing
        Dim mtv As Rhino.Geometry.Collections.MeshTopologyVertexList = Nothing
        Dim mte As Rhino.Geometry.Collections.MeshTopologyEdgeList = Nothing
        Dim ev As New list(Of vector3d)
        Dim ed As New list(Of Double)
        Dim en As New list(Of Boolean)
        Dim mc,ec,tc,cc,fc,ecc,nc As New list(Of color)
        Dim xf As New list(Of meshface)

        If clr.count() = 0 Then clr.add(color.LightGray) Else biC = True

        If bm Then
          'Start Deconstruct if Mesh
          msh = G0

          mshe = msh.Duplicate()
          mte = mshe.TopologyEdges()
          mtv = mshe.TopologyVertices()
          mf = mshe.Faces()

          bnk = mshe.GetNakedEdgePointStatus()

          If G1 IsNot Nothing Then
            msha = G1

            If msh.Vertices.Count() <> msha.vertices.count() Then Exit Sub
          Else
            msha = msh.Offset(-d)
          End If

          msh.Append(msha)

          If i.count() = 0 Then I = Enumerable.Range(0, mf.Count()).ToList()

          mv = msh.Vertices().ToPoint3dArray().tolist()

          cf = I.Count()

          'Assign Colors
          If mshe.VertexColors.Count() < 1 Then
            mshe.VertexColors.CreateMonotoneMesh(color.LightGray)
            bmC = biC
          Else
            bmC = True
          End If

          If msha.VertexColors.Count() > 0 Then bmC = True

          mc = mshe.VertexColors().ToArray().ToList()
          If msha.VertexColors.count() < 1 Then mc.addrange(mc) Else mc.addrange(msha.VertexColors().ToArray().ToList())
        Else
          'Start Deconstruct if Curve
          crv = G0

          I.clear()
          I.add(0)
          Dim nbc As nurbscurve
          Dim pc As polyline
          Dim nps As Rhino.Geometry.Collections.NurbsCurvePointList

          nbc = crv.ToNurbsCurve()
          nps = nbc.Points
          pc = nbc.Points.ControlPolygon
          If (Not pc.IsClosed) Then pc.add(pc(0))
          av(0) = pc.CenterPoint

          msh.Vertices.AddVertices(pc.ToArray())
          msh.faces.addfaces(pc.TriangulateClosedPolyline())
          msh.Vertices.Remove(pc.count() - 1, True)

          mv = msh.Vertices.ToPoint3dArray().tolist()
          mte = msh.TopologyEdges()
          mtv = msh.TopologyVertices()

          ReDim bnk(mv.count() - 1)
          For j = 0 To mv.count() - 1 Step 1
            bnk(j) = True
          Next

          'Assign Colors
          If bic Then bmC = True

          If G1 IsNot Nothing Then
            crva = G1
            nbc = crva.ToNurbsCurve()
            nps = nbc.Points
            pc = nbc.Points.ControlPolygon
            If (Not pc.IsClosed) Then pc.add(pc(0))
            av(1) = pc.CenterPoint
            pc.RemoveAt(pc.count() - 1)

            If pc.count() <> mv.count() Then Exit Sub

            cf = 1
            mv.addrange(pc)
          Else
            Dim tcpt As point3d
            msh.Normals.ComputeNormals()
            msh.Normals.UnitizeNormals()
            k = mv.count()
            For j = 0 To k - 1 Step 1
              mv.add(mv.item(j) + msh.Normals(j) * d)
              tcpt += mv.item(j) + msh.Normals(j) * d
            Next

            cf = 1
            av(1) = tcpt / k
          End If

        End If
        ce = mte.count()
        cv = mv.count() / 2
        dcv = mv.count()

        x = appendprepend(cv - 1)
        'Match variables and colors to vertex count
        If (T0.count()) < cv Then T0 = dblDList(matchDbl(T0, cv)) Else If (T0.count()) = cv Then T0.addrange(T0) Else If (T0.count()) < dcv Then T0 = matchDbl(T0, dcv)
        If (T1.count()) < cv Then T1 = dblDList(matchDbl(T1, cv)) Else If (T1.count()) = cv Then T1.addrange(T1) Else If (T1.count()) < dcv Then T1 = matchDbl(T1, dcv)
        If (clr.count()) < cv Then clr = dblCList(matchClr(clr, cv)) Else If (clr.count()) = cv Then clr.addrange(clr)Else If (clr.count()) < dcv Then clr = matchClr(clr, dcv)

        If bp Then
          mc = clr
          ac = colorCap(mc)
        End If

        'Edge based vertices
        k = 0
        Dim cpt As point3d
        Dim ccl As color
        Dim bce As Boolean

        Dim tpt(3) As point3d
        Dim tcl(3) As color
        jj = 0
        For j = 0 To ce - 1 Step 1
          If (bm Or (bp And (mte.GetConnectedFaces(j).Count() < 2))) Then
            ua = mtv.MeshVertexIndices(mte.GetTopologyVertices(j).I)(0)
            va = mtv.MeshVertexIndices(mte.GetTopologyVertices(j).J)(0)

            ub = ua + cv
            vb = va + cv

            cpt = (mv(ua) + mv(va) + mv(ub) + mv(vb)) / 4
            ccl = avg4Clr(mc(ua), mc(va), mc(ub), mc(vb))
            bce = mte.GetConnectedFaces(j).count() <> 2

            tpt(0) = evalP(mv(ua), mv(va), t0(ua) / 2)
            tcl(0) = evalC(mc(ua), mc(va), t0(ua) / 2)
            tpt(1) = evalP(mv(va), mv(ua), t0(va) / 2)
            tcl(1) = evalC(mc(va), mc(ua), t0(va) / 2)
            tpt(2) = evalP(mv(ub), mv(vb), t0(ub) / 2)
            tcl(2) = evalC(mc(ub), mc(vb), t0(ub) / 2)
            tpt(3) = evalP(mv(vb), mv(ub), t0(vb) / 2)
            tcl(3) = evalC(mc(vb), mc(ub), t0(vb) / 2)

            'To the Face Center
            ep.add(evalP(tpt(0), tpt(2), t1(ua) / 2))
            ec.add(evalC(tcl(0), tcl(2), t1(ua) / 2))
            en.add(bce)
            mev.add(ua & "," & va & "," & 0, k)

            ep.add(evalP(tpt(2), tpt(0), t1(ub) / 2))
            ec.add(evalC(tcl(2), tcl(0), t1(ub) / 2))
            en.add(bce)
            mev.add(ub & "," & vb & "," & 0, k + 1)

            ep.add(evalP(tpt(1), tpt(3), t1(va) / 2))
            ec.add(evalC(tcl(1), tcl(3), t1(va) / 2))
            en.add(bce)
            mev.add(va & "," & ua & "," & 0, k + 2)

            ep.add(evalP(tpt(3), tpt(1), t1(vb) / 2))
            ec.add(evalC(tcl(3), tcl(1), t1(vb) / 2))
            en.add(bce)
            mev.add(vb & "," & ub & "," & 0, k + 3)

            If (c And f) Then
              ecv.add(evalP((mv(ua) + mv(va)) / 2, (mv(ub) + mv(vb)) / 2, (t1(ua) + t1(va)) / 4))
              ecc.add(evalC(evalC(mc(ua), mc(va), 0.5), evalC(mc(ub), mc(vb), 0.5), (t1(ua) + t1(va)) / 4))
              mev.add(ua & "," & va & "," & 3, jj)
              mev.add(va & "," & ua & "," & 3, jj)

              ecv.add(evalP((mv(ub) + mv(vb)) / 2, (mv(ua) + mv(va)) / 2, (t1(ub) + t1(vb)) / 4))
              ecc.add(evalC(evalC(mc(ub), mc(vb), 0.5), evalC(mc(ua), mc(va), 0.5), (t1(ub) + t1(vb)) / 4))
              mev.add(ub & "," & vb & "," & 3, jj + 1)
              mev.add(vb & "," & ub & "," & 3, jj + 1)

              jj += 2
            End If

            If f Then
              ep.add(tpt(0))
              ec.add(tcl(0))
              en.add(bce)
              mev.add(ua & "," & va & "," & 1, k + 4)

              ep.add(tpt(1))
              ec.add(tcl(1))
              en.add(bce)
              mev.add(va & "," & ua & "," & 1, k + 5)

              ep.add(tpt(2))
              ec.add(tcl(2))
              en.add(bce)
              mev.add(ub & "," & vb & "," & 1, k + 6)

              ep.add(tpt(3))
              ec.add(tcl(3))
              en.add(bce)
              mev.add(vb & "," & ub & "," & 1, k + 7)

              ep.add((mv(ua) + mv(va)) / 2)
              ec.add(evalC(mc(ua), mc(va), 0.5))
              en.add(bce)
              mev.add(ua & "," & va & "," & 2, k + 8)
              mev.add(va & "," & ua & "," & 2, k + 8)

              ep.add((mv(ub) + mv(vb)) / 2)
              ec.add(evalC(mc(ub), mc(vb), 0.5))
              en.add(bce)
              mev.add(ub & "," & vb & "," & 2, k + 9)
              mev.add(vb & "," & ub & "," & 2, k + 9)

              k += 10
            Else
              k += 4
            End If
          End If
        Next

        k = 0
        For j = 0 To ubound(bnk) Step 1
          np.add(mv(j))
          nc.add(mc(j))
          mvv.add(j & "," & j + cv & "," & 0, k)

          np.add(mv(j + cv))
          nc.add(mc(j + cv))
          mvv.add(j + cv & "," & j & "," & 0, k + 1)

          k += 2
        Next

        'Face based vertices
        Dim xv(),mt(),ei(),xi() As Integer
        Dim xca(),xcb(),xta(),xtb() As color
        Dim xn(1) As Double
        ReDim ei(17)
        ReDim xi(1)
        u = 4
        If f Then u += 4
        v += ep.count()
        If (Not f) Then v += np.count()
        If (c And f) Then v += ecv.count()

        For jj = 0 To I.count() - 1 Step 1
          Dim tcv As New point3d
          j = I(jj)
          w = v + tv.count()
          xn(0) = 0
          xn(1) = 0
          If bm Then
            If mf(j).isquad() Then h = 4 Else h = 3
            ReDim xv(h - 1)
            ReDim xca(h - 1)
            ReDim xcb(h - 1)
            ReDim xta(h - 1)
            ReDim xtb(h - 1)
            mt = mf.GetTopologicalVertices(j)
            For k = 0 To h - 1 Step 1
              xv(k) = mtv.MeshVertexIndices(mt(k))(0)
              xca(k) = mc(xv(k))
              xcb(k) = mc(xv(k) + cv)
              xta(k) = clr(xv(k))
              xtb(k) = clr(xv(k) + cv)
            Next
            av(0) = mf.GetFaceCenter(j)
            av(1) = msh.faces.GetFaceCenter(j + cf)
            ac(0) = avgClr(xca)
            ac(1) = avgClr(xcb)
            ax(0) = avgClr(xta)
            ax(1) = avgClr(xtb)
            If biC Then ac(2) = sumC(ax(0), ax(1)) Else ac(2) = sumC(ac(0), ac(1))
          Else
            h = cv
            xv = Enumerable.Range(0, h).ToArray()
          End If
          For k = 0 To h - 1 Step 1
            xn(0) += T0(xv(k))
            xn(1) += T0(xv(k) + cv)
          Next
          xn(0) /= h
          xn(1) /= h
          av(2) = (av(0) + av(1)) / 2
          y = appendprepend(h - 1)

          For k = 1 To h Step 1
            ei(0) = mev.item(xv(y(k)) & "," & xv(y(k + 1)) & "," & 0)
            ei(1) = mev.item(xv(y(k + 1)) & "," & xv(y(k)) & "," & 0)
            ei(2) = mev.item(xv(y(k)) + cv & "," & xv(y(k + 1)) + cv & "," & 0)
            ei(3) = mev.item(xv(y(k + 1)) + cv & "," & xv(y(k)) + cv & "," & 0)

            If f Then
              ei(4) = mev.item(xv(y(k)) & "," & xv(y(k - 1)) & "," & 0)
              ei(5) = mev.item(xv(y(k)) + cv & "," & xv(y(k - 1)) + cv & "," & 0)

              ei(6) = mev.item(xv(y(k)) & "," & xv(y(k + 1)) & "," & 1)
              ei(7) = mev.item(xv(y(k)) & "," & xv(y(k - 1)) & "," & 1)

              ei(8) = mev.item(xv(y(k)) + cv & "," & xv(y(k + 1)) + cv & "," & 1)
              ei(9) = mev.item(xv(y(k)) + cv & "," & xv(y(k - 1)) + cv & "," & 1)

              ei(10) = mev.item(xv(y(k)) & "," & xv(y(k + 1)) & "," & 2)
              ei(11) = mev.item(xv(y(k)) & "," & xv(y(k - 1)) & "," & 2)

              ei(12) = mev.item(xv(y(k)) + cv & "," & xv(y(k + 1)) + cv & "," & 2)
              ei(13) = mev.item(xv(y(k)) + cv & "," & xv(y(k - 1)) + cv & "," & 2)

              tpt(0) = evalP((mv(xv(y(k))) + mv(xv(y(k + 1)))) / 2, av(0), (t0(xv(y(k))) + t0(xv(y(k + 1)))) / 2)
              tcl(0) = evalC(evalC(mc(xv(y(k))), mc(xv(y(k + 1))), 0.5), ac(0), (t0(xv(y(k))) + t0(xv(y(k + 1)))) / 2)
              tpt(1) = evalP((mv(xv(y(k)) + cv) + mv(xv(y(k + 1)) + cv)) / 2, av(1), (t0(xv(y(k)) + cv) + t0(xv(y(k + 1)) + cv)) / 2)
              tcl(1) = evalC(evalC(mc(xv(y(k)) + cv), mc(xv(y(k + 1)) + cv), 0.5), ac(1), (t0(xv(y(k)) + cv) + t0(xv(y(k + 1)) + cv)) / 2)
            Else
              tpt(0) = evalP(mv(xv(y(k))), av(0), t0(xv(y(k))))
              tcl(0) = evalC(mc(xv(y(k))), ac(0), t0(xv(y(k))))
              tpt(1) = evalP(mv(xv(y(k)) + cv), av(1), t0(xv(y(k)) + cv))
              tcl(1) = evalC(mc(xv(y(k)) + cv), ac(1), t0(xv(y(k)) + cv))
            End If
            tpt(2) = evalP(tpt(0), tpt(1), t1(xv(y(k))) / 2)
            tcl(2) = evalC(tcl(0), ac(2), t1(xv(y(k))))
            tpt(3) = evalP(tpt(1), tpt(0), t1(xv(y(k)) + cv) / 2)
            tcl(3) = evalC(tcl(1), ac(2), t1(xv(y(k)) + cv))

            'Define new per face vertices
            tv.add(tpt(0))
            tc.add(tcl(0))

            tv.add(tpt(1))
            tc.add(tcl(1))

            tv.add(tpt(2))
            tc.add(tcl(2))

            tv.add(tpt(3))
            tc.add(tcl(3))

            'Define new faces
            If f Then
              tv.add((tpt(2) + ep(ei(0))) / 2)
              tc.add(evalC(tcl(2), ec(ei(0)), 0.5))

              tv.add((tpt(2) + ep(ei(1))) / 2)
              tc.add(evalC(tcl(2), ec(ei(1)), 0.5))

              tv.add((tpt(3) + ep(ei(2))) / 2)
              tc.add(evalC(tcl(3), ec(ei(2)), 0.5))

              tv.add((tpt(3) + ep(ei(3))) / 2)
              tc.add(evalC(tcl(3), ec(ei(3)), 0.5))

              xf.add(New meshface(ei(0), ei(4), ei(7), ei(6)))
              xf.add(New meshface(ei(11), ei(10), ei(6), ei(7)))
              xf.add(New meshface(ei(11), w + y(k - 1) * u + 0, w + y(k) * u + 0, ei(10)))
              xf.add(New meshface(w + y(k) * u + 4, w + y(k) * u + 2, w + y(k - 1) * u + 2, w + y(k - 1) * u + 5))
              xf.add(New meshface(ei(0), w + y(k) * u + 4, w + y(k - 1) * u + 5, ei(4)))
              xf.add(New meshface(w + y(k) * u + 4, ei(0), ei(2), w + y(k) * u + 6))
              xf.add(New meshface(w + y(k) * u + 2, w + y(k) * u + 4, w + y(k) * u + 6, w + y(k) * u + 3))
              xf.add(New meshface(w + y(k) * u + 0, w + y(k) * u + 2, w + y(k + 1) * u + 2, w + y(k + 1) * u + 0))
              xf.add(New meshface(ei(4), w + y(k - 1) * u + 5, w + y(k - 1) * u + 7, ei(5)))
              xf.add(New meshface(w + y(k - 1) * u + 2, w + y(k - 1) * u + 3, w + y(k - 1) * u + 7, w + y(k - 1) * u + 5))
              xf.add(New meshface(w + y(k) * u + 6, ei(2), ei(5), w + y(k - 1) * u + 7))
              xf.add(New meshface(w + y(k) * u + 3, w + y(k) * u + 6, w + y(k - 1) * u + 7, w + y(k - 1) * u + 3))
              xf.add(New meshface(ei(2), ei(8), ei(9), ei(5)))
              xf.add(New meshface(ei(8), ei(12), ei(13), ei(9)))
              xf.add(New meshface(ei(12), w + y(k) * u + 1, w + y(k - 1) * u + 1, ei(13)))
              xf.add(New meshface(w + y(k) * u + 1, w + y(k) * u + 3, w + y(k - 1) * u + 3, w + y(k - 1) * u + 1))

            Else
              xf.add(New meshface(ep.count() + xv(y(k + 1)) * 2, ep.count() + xv(y(k)) * 2, w + y(k) * u + 0, w + y(k + 1) * u + 0))
              xf.add(New meshface(w + y(k) * u + 0, w + y(k) * u + 2, w + y(k + 1) * u + 2, w + y(k + 1) * u + 0))
              xf.add(New meshface(w + y(k) * u + 2, ei(0), ei(1), w + y(k + 1) * u + 2))
              xf.add(New meshface(ei(0), w + y(k) * u + 2, w + y(k) * u + 3, ei(2)))
              xf.add(New meshface(w + y(k + 1) * u + 2, ei(1), ei(3), w + y(k + 1) * u + 3))
              xf.add(New meshface(ei(2), w + y(k) * u + 3, w + y(k + 1) * u + 3, ei(3)))
              xf.add(New meshface(w + y(k) * u + 3, w + y(k) * u + 1, w + y(k + 1) * u + 1, w + y(k + 1) * u + 3))
              xf.add(New meshface(ep.count() + xv(y(k)) * 2 + 1, ep.count() + xv(y(k + 1)) * 2 + 1, w + y(k + 1) * u + 1, w + y(k) * u + 1))
            End If

            If c Then
              If en.item(ei(0)) Then
                If f Then
                  ei(14) = v - ecv.count() + mev.item(xv(y(k)) & "," & xv(y(k + 1)) & "," & 3)
                  ei(15) = v - ecv.count() + mev.item(xv(y(k)) + cv & "," & xv(y(k + 1)) + cv & "," & 3)
                  ei(16) = mev.item(xv(y(k + 1)) & "," & xv(y(k)) & "," & 1)
                  ei(17) = mev.item(xv(y(k + 1)) + cv & "," & xv(y(k)) + cv & "," & 1)

                  xf.add(New meshface(ei(14), ei(0), ei(6), ei(10)))
                  xf.add(New meshface(ei(1), ei(14), ei(10), ei(16)))
                  xf.add(New meshface(ei(14), ei(1), ei(3), ei(15)))
                  xf.add(New meshface(ei(2), ei(0), ei(14), ei(15)))
                  xf.add(New meshface(ei(2), ei(15), ei(12), ei(8)))
                  xf.add(New meshface(ei(17), ei(12), ei(15), ei(3)))

                Else
                  xf.add(New meshface(ei(1), ei(0), ep.count() + xv(y(k)) * 2, ep.count() + xv(y(k + 1)) * 2))
                  xf.add(New meshface(ei(0), ei(2), ep.count() + xv(y(k)) * 2 + 1, ep.count() + xv(y(k)) * 2))
                  xf.add(New meshface(ei(2), ei(3), ep.count() + xv(y(k + 1)) * 2 + 1, ep.count() + xv(y(k)) * 2 + 1))
                  xf.add(New meshface(ei(3), ei(1), ep.count() + xv(y(k + 1)) * 2, ep.count() + xv(y(k + 1)) * 2 + 1))
                End If
              End If
            End If
          Next
          fv.add(evalP(av(2), av(0), xn(0)))
          cc.add(evalC(ac(2), ac(0), xn(0)))

          fv.add(evalP(av(2), av(1), xn(1)))
          cc.add(evalC(ac(2), ac(1), xn(1)))
        Next

        Dim om As New mesh
        om.Vertices.AddVertices(ep.toarray())
        If bmC Then om.VertexColors.AppendColors(ec.toarray())
        If (Not f) Then
          om.Vertices.AddVertices(np.toarray())
          If bmC Then om.VertexColors.AppendColors(nc.toarray())
        End If

        If (c And f) Then
          om.Vertices.AddVertices(ecv.toarray())
          If bmC Then om.VertexColors.AppendColors(ecc.toarray())
        End If

        om.Vertices.AddVertices(tv.toarray())
        If bmC Then om.VertexColors.AppendColors(tc.toarray())

        om.Faces.AddFaces(xf.toarray())


        'If i.count() > 0 Then om.Vertices.CullUnused()

        A = om
      End If
    End If
# ---------- box: VB additional code ----------
  Private Function appendprepend(ByVal i As Integer)
    Dim srsEnum As IEnumerable(Of Integer) = Enumerable.Range(0, i + 1)
    Dim arrVal As New list(Of Integer)
    arrVal = srsEnum.tolist()
    arrVal.add(0)
    arrVal.insert(0, i)
    Return arrVal.toarray()
  End Function

  Private Function colorCap(ByVal c As list(Of color))
    Dim i,k As Integer
    k = c.count() / 2
    Dim r(2),g(2),b(2) As Integer
    For i = 0 To k - 1 Step 1
      r(0) += c.item(i).R
      r(1) += c.item(i + k).R
      g(0) += c.item(i).g
      g(1) += c.item(i + k).g
      b(0) += c.item(i).b
      b(1) += c.item(i + k).b
    Next

    r(0) = CInt(r(0) / k)
    r(1) = CInt(r(1) / k)
    g(0) = CInt(g(0) / k)
    g(1) = CInt(g(1) / k)
    b(0) = CInt(b(0) / k)
    b(1) = CInt(b(1) / k)

    r(2) = CInt((r(0) + r(1)) / 2)
    g(2) = CInt((g(0) + g(1)) / 2)
    b(2) = CInt((b(0) + b(1)) / 2)

    If r(0) > 255 Then r(0) = 255 Else If r(0) < 0 Then r(0) = 0
    If r(1) > 255 Then r(1) = 255 Else If r(1) < 0 Then r(1) = 0
    If g(0) > 255 Then g(0) = 255 Else If g(0) < 0 Then g(0) = 0
    If g(1) > 255 Then g(1) = 255 Else If g(1) < 0 Then g(1) = 0
    If b(0) > 255 Then b(0) = 255 Else If b(0) < 0 Then b(0) = 0
    If b(1) > 255 Then b(1) = 255 Else If b(1) < 0 Then b(1) = 0

    If r(2) > 255 Then r(2) = 255 Else If r(2) < 0 Then r(2) = 0
    If g(2) > 255 Then g(2) = 255 Else If g(2) < 0 Then g(2) = 0
    If b(2) > 255 Then b(2) = 255 Else If b(2) < 0 Then b(2) = 0

    Return {color.FromArgb(r(0), G(0), b(0)),color.FromArgb(r(1), G(1), b(1)),color.FromArgb(r(2), G(2), b(2))}
  End Function

  Private Function dblCList(ByVal a As list(Of color))
    a.addrange(a)
    Return a
  End Function

  Private Function dblDList(ByVal a As list(Of Double))
    a.addrange(a)
    Return a
  End Function

  Private Function matchDbl(ByVal a As list(Of Double), ByVal t As Integer)
    Dim i,k As Integer
    k = a.count()
    For i = 0 To ((t + 1) - k) - 1 Step 1
      a.add(a.item(k - 1))
    Next
    Return a
  End Function

  Private Function matchClr(ByVal a As list(Of Color), ByVal t As Integer)
    Dim i,k As Integer
    k = a.count()
    For i = 0 To ((t + 1) - k) - 1 Step 1
      a.add(a.item(k - 1))
    Next
    Return a
  End Function

  Private Function sumC(ByVal ca As Color, ByVal cb As Color)
    Dim r,g,b As Integer

    r = CInt((CInt(ca.R) + CInt(cb.R)) / 2)
    g = CInt((CInt(ca.g) + CInt(cb.g)) / 2)
    b = CInt((CInt(ca.b) + CInt(cb.b)) / 2)

    If r > 255 Then r = 255 Else If r < 0 Then r = 0
    If G > 255 Then G = 255 Else If G < 0 Then G = 0
    If b > 255 Then b = 255 Else If b < 0 Then b = 0

    Return color.FromArgb(r, G, b)
  End Function

  Private Function avg4Clr(ByVal ca As Color, ByVal cb As Color, ByVal cc As Color, ByVal cd As Color)
    Dim r,g,b As Integer

    r = CInt((CInt(ca.R) + CInt(cb.R) + CInt(cc.R) + CInt(cd.R)) / 4)
    g = CInt((CInt(ca.g) + CInt(cb.g) + CInt(cc.g) + CInt(cd.g)) / 4)
    b = CInt((CInt(ca.b) + CInt(cb.b) + CInt(cc.b) + CInt(cd.b)) / 4)

    If r > 255 Then r = 255 Else If r < 0 Then r = 0
    If G > 255 Then G = 255 Else If G < 0 Then G = 0
    If b > 255 Then b = 255 Else If b < 0 Then b = 0

    Return color.FromArgb(r, G, b)
  End Function

  Private Function evalP(ByVal op As point3d, ByVal tp As Point3d, ByVal t As Double)
    Return New point3d(op + (tp - op) * t)
  End Function

  Private Function evalV(ByVal ov As vector3d, ByVal tv As vector3d, ByVal t As Double)
    Return New vector3d(ov + (tv - ov) * t)
  End Function

  Private Function evalN(ByVal u As Double, ByVal v As Double, ByVal t As Double)
    Return u + (v - u) * t
  End Function

  Private Function avgVec(ByVal v() As vector3f)
    Dim i As Integer
    Dim tv As Vector3d

    For i = 0 To ubound(v) Step 1
      tv += v(i)
    Next
    tv /= (ubound(v) + 1)
    tv.Unitize()
    Return New vector3f(tv.X, tv.Y, tv.Z)
  End Function

  Private Function roundClr(ByVal r As Integer, ByVal G As Integer, ByVal b As Integer, ByVal i As Integer)
    r = CInt(r / i)
    G = CInt(G / i)
    b = CInt(b / i)

    If r > 255 Then r = 255 Else If r < 0 Then r = 0
    If G > 255 Then G = 255 Else If G < 0 Then G = 0
    If b > 255 Then b = 255 Else If b < 0 Then b = 0

    Return color.FromArgb(r, G, b)
  End Function

  Private Function avgClr(ByVal c() As color)
    Dim r,G,b As Integer
    Dim i,k As Integer

    k = ubound(c) + 1

    For i = 0 To k - 1 Step 1
      r += CInt(c(i).R)
      G += CInt(c(i).G)
      b += CInt(c(i).B)
    Next

    r = CInt(r / k)
    G = CInt(G / k)
    b = CInt(b / k)

    If r > 255 Then r = 255 Else If r < 0 Then r = 0
    If G > 255 Then G = 255 Else If G < 0 Then G = 0
    If b > 255 Then b = 255 Else If b < 0 Then b = 0

    Return color.FromArgb(r, G, b)
  End Function

  Private Function evalC(ByVal oc As color, ByVal tc As color, ByVal t As Double)
    Dim r,G,b As Integer
    r = CInt(CInt(oc.R) + (CInt(tc.R) - CInt(oc.R)) * t)
    G = CInt(CInt(oc.G) + (CInt(tc.G) - CInt(oc.G)) * t)
    b = CInt(CInt(oc.B) + (CInt(tc.B) - CInt(oc.B)) * t)

    If r > 255 Then r = 255 Else If r < 0 Then r = 0
    If G > 255 Then G = 255 Else If G < 0 Then G = 0
    If b > 255 Then b = 255 Else If b < 0 Then b = 0

    Return color.FromArgb(r, G, b)
  End Function

  ''' <summary>
  ''' This method will be called once every solution, before any calls to RunScript.
  ''' </summary>
  Public Overrides Sub BeforeRunScript()
  End Sub
  ''' <summary>
  ''' This method will be called once every solution, after any calls to RunScript.
  ''' </summary>
  Public Overrides Sub AfterRunScript()
  End Sub
# ---------- end box ----------
mesh_join_3 = MeshJoin(Meshes=scale_4.Geometry)  # disabled
mesh_join_4 = MeshJoin(Meshes=scale_5.Geometry)  # disabled
power_2 = Power(Value1=2, Value2=0.5, UseClamp=False)
mesh = Mesh(scale_2.Geometry)
weaverbird_s_catmull_clark_subdivision_3 = WeaverbirdsCatmullClarkSubdivision(MeshCurves=mesh, Level=2, SmoothNakedEdges=1)  # disabled
deconstruct_mesh_3 = DeconstructMesh(Mesh=weaverbird_s_catmull_clark_subdivision_3)  # -> Vertices, Faces, Colours, Normals; disabled
pull_point_2 = PullPoint(Point=deconstruct_mesh_3.Vertices, Geometry=geometry_4, ClosestOnly=True)  # -> ClosestPoint, Distance; disabled
colour_swatch = ColourSwatch(SwatchColor=RGB(0, 191, 191))
subtract = Subtract(Value1=power_2, Value2=1, UseClamp=False)
construct_mesh_3 = ConstructMesh(Vertices=pull_point_2.ClosestPoint, Faces=deconstruct_mesh_3.Faces)  # disabled
weaverbird_s_constant_quads_split_subdiv = WeaverbirdsConstantQuadsSplitSubdivision(MeshCurves=mesh, Level=1, SmoothNakedEdges=1)  # disabled
geometry_5 = Geometry()  # -> Position, Normal, Tangent, TrueNormal, Incoming, Parametric, Backfacing, Pointiness
dot_product = DotProduct(Vector1=geometry_5.Normal, Vector2=geometry_5.Incoming)  # -> Value, Vector
subtract_2 = Subtract(Value1=1, Value2=dot_product.Vector, UseClamp=False)

digit_scroller_14 = DigitScroller(Scroller_Digits=12, Scroller_Prefix="Digit Scroller", Scroller_Radix=2, Scroller_Value=4)
layer_weight = LayerWeight(Blend=0.5, Normal=geometry_5.Normal)  # -> Fresnel, Facing
digit_scroller_15 = DigitScroller(Scroller_Digits=12, Scroller_Prefix="Digit Scroller", Scroller_Radix=1, Scroller_Value=0.65625)
divide = Divide(Value1=digit_scroller_14, Value2="19.48046875", UseClamp=False)
subtract_3 = Subtract(Value1=1, Value2=layer_weight.Facing, UseClamp=False)
power_3 = Power(Value1=subtract_3, Value2=divide, UseClamp=False)
subtract_4 = Subtract(Value1=1, Value2=digit_scroller_15, UseClamp=False)
multiply = Multiply(Value1=power_3, Value2=subtract_4, UseClamp=False)
add = Add(Value1=multiply, Value2=1, UseClamp=False)
subtract_5 = Subtract(Value1=add, Value2=subtract_4, UseClamp=False)

gradient = Gradient(Vector=layer_weight.Facing, Gradient="Spherical")  # -> Color, Fac
split_ahsv = SplitAHSV(Colour=gradient.Color)  # -> Alpha, Hue, Saturation, Value
subtract_6 = Subtract(Value1=1, Value2=split_ahsv.Value, UseClamp=False)
panel_10 = Panel(split_ahsv.Value)
divide_2 = Divide(Value1=gradient.Fac, Value2=4, UseClamp=False)
multiply_2 = Multiply(Value1=split_ahsv.Value, Value2=power_2, UseClamp=False)
mapping_node = MappingNode(Vector=geometry_5.Normal, Location="1,1,0", Rotation=Vector(0, 0, 0), Scale="2,2,1")
subtract_7 = Subtract(Value1=1, Value2=gradient.Fac, UseClamp=False)
image = Image(
    Vector=geometry_5.Normal,
    DecalForward=0,
    DecalUsage=0,
    ImTexColorSpace="None",
    ImTexInterpolation="Closest",
    ImTexProjection="Flat",
    ImTexTextureExtension="Repeat",
    Image="C:\O\O_AIDIW_O_WIDIA_O\O_REDNELB_O_BLENDER_O\O____ΛATϽCAЯRΦ_ΦΛƎEƧS_GИNIЯR____O____ЯRIИNG_ƧSƎEΛΦ_ΦЯRAϽCTAΛ____O\1.2.3.4.16384...TIF.8BPC.GRAYA.4.4096.PNG")  # -> Color, Alpha
cross_product = CrossProduct(Vector1=geometry_5.Incoming, Vector2=geometry_5.Normal)  # -> Value, Vector
color_ramp = ColorRamp(
    Fac=subtract_7,
    StopColours=[ColourSwatch(SwatchColor=RGB(232, 232, 232)), ColourSwatch(SwatchColor=RGB(255, 255, 255))],
    StopPositions=[0, 1],
    Interpolation="Linear")  # -> Color, Alpha
dot_product_2 = DotProduct(Vector1=geometry_5.Normal, Vector2=geometry_5.Incoming)  # -> Value, Vector
subtract_8 = Subtract(Value1=1, Value2=dot_product_2.Value, UseClamp=False)
sphere = Sphere(Base=PlaneXY(0, 0, 0), Radius=1)
geometry_6 = Geometry(flatten(list_item_3))
subtract_9 = Subtract(Value1=subtract_8, Value2=0.5, UseClamp=False)
mesh_brep_2 = MeshBrep(
    Brep=geometry_6,
    Settings={GridMaxCount=0, GridMinCount=16, JaggedSeams=False, MaxEdgeLength=0, MinEdgeLength=0.0001, MinTolerance=0, Refine=True, RefineAngle=0, RelativeTolerance=0.65, SimplePlanes=True, Tolerance=0})
color2bw = Color2Bw(Color=dot_product_2.Value)
diffuse_bsdf = DiffuseBSDF(Color=RGB(0, 0, 0), Roughness=0, Normal=Vector(0, 0, 0))
transparent_bsdf = TransparentBSDF(Color=RGB(255, 255, 255))

output = Output(Surface=subtract_5, Volume=RGB(128, 128, 128), Displacement=Vector(0, 0, 0))
custom_preview = CustomPreview(
    Geometry=mesh_brep_2,
    Material={diffuse=RGB(255, 105, 180), emission=RGB(0, 0, 0), shine=0, specular=RGB(255, 255, 255), transparency=0})

blend = Blend(Closure1=transparent_bsdf, Closure2=diffuse_bsdf, Fac=geometry_5.Position)
infoglasses = InfoGlasses(Run=True, Language=0, assemSet=False, cateSet=False, showName=False)
