# Grasshopper definition XHꓨ.𖣠⚪ᗱᗴᙁᑐᑕᴥꖴᑎ¤ᔓᔕ▢ᴥᗩᙁⓄߦ𖥤⚪𔗢⚪🞋⚪𔗢⚪𖥤ߦⓄᙁᗩᴥ▢ᔓᔕ¤ᑎꖴᴥᑐᑕᙁᗱᗴ⚪𖣠.GHX (Grasshopper 1.0.7)
# plug-ins: GhPython Script

digit_scroller = DigitScroller(Scroller_Digits=12, Scroller_Prefix=" ", Scroller_Radix=1, Scroller_Value=4.125)
range = Range(Domain=Domain(0, 1.570796327), Steps=256)
curve = Curve(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)
scale = Scale(Geometry=curve, Center=Point(0, 0, 0), Factor=2)  # -> Geometry, Transform
digit_scroller_2 = DigitScroller(Scroller_Digits=12, Scroller_Prefix=" ", Scroller_Radix=1, Scroller_Value=1.514089832)
expression = Expression(A=digit_scroller_2, Y=range, Expression="SIN(ABS(Y))^(1/A)")
expression_2 = Expression(A=digit_scroller_2, X=range, Expression="COS(ABS(X))^(1/A)")
expression_3 = Expression(O=range, A=digit_scroller, Expression="(A^2 - cos(O*4))/(A^2 - 1)")
point_polar = PointPolar(BasePlane=PlaneXY(0, 0, 0), XYAngle=0, ZAngle=range, Offset=expression_3)
rotate = Rotate(Geometry=scale.Geometry, Angle=degrees(90), Plane=PlaneYZ(0, 0, 0))  # -> Geometry, Transform
construct_point = ConstructPoint(XCoordinate=expression_2, YCoordinate=0, ZCoordinate=expression)
digit_scroller_3 = DigitScroller(Scroller_Digits=12, Scroller_Prefix="Digit Scroller", Scroller_Radix=1, Scroller_Value=0.046875)
interpolate = Interpolate(Vertices=point_polar, Degree=3, Periodic=False, KnotStyle=2)  # -> Curve, Length, Domain
interpolate_2 = Interpolate(Vertices=construct_point, Degree=3, Periodic=False, KnotStyle=2)  # -> Curve, Length, Domain
rotate_2 = Rotate(Geometry=rotate.Geometry, Angle=-1.570796327, Plane=Plane(origin=(0, 0, 0), x=(0, 0, 1), y=(1, 0, 0)))  # -> Geometry, Transform
move = Move(Geometry=rotate_2.Geometry, Motion=Vector(1, 0, 0))  # -> Geometry, Transform
옷_ᑫᑭ_ᗩ_ᴥ_ᕤᕦ_ᗝ_ᗱᗴ_ᑫᑭ_ᗩ_옷_ᔓᔕ_ᔓᔕ_ᗱᗴ_ᑐᑕ_иn_ᗱ = 옷ᑫᑭᗩᴥᕤᕦᗝᗱᗴᑫᑭᗩ옷ᔓᔕᔓᔕᗱᗴᑐᑕИNᗱᗴᴥᗱᗴΘᗝᗱᗴᴥᑎᗩᗯᴥᑎᑐᑕᑐᑕᑎᴥᗯᗩᑎᴥᗱᗴᗝΘᗱᗴᴥᗱᗴИNᑐᑕᗱᗴᔓᔕᔓᔕ옷ᗩᑫᑭᗱᗴᗝᕤᕦᴥᗩᑫᑭ옷(
    x=False,
    x_2=".05",
    x_3=False,
    x_20=digit_scroller_3,
    x_21=digit_scroller_3,
    x_22=digit_scroller_3,
    x_23=digit_scroller_3,
    x_24=digit_scroller_3,
    x_25=digit_scroller_3,
    x_26=digit_scroller_3,
    x_4=digit_scroller_3,
    x_7=graft([0, 180]),
    x_8=256,
    Ω=move.Geometry)  # -> x_29, x_28, x_5, x_30, iiiiiiiiiiiiiiii, iiiiiiiiiiiiiii, iiiiiiiiiiiiii, iiiiiiiiiiiii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
curve_display = CurveDisplay(Curves=옷_ᑫᑭ_ᗩ_ᴥ_ᕤᕦ_ᗝ_ᗱᗴ_ᑫᑭ_ᗩ_옷_ᔓᔕ_ᔓᔕ_ᗱᗴ_ᑐᑕ_иn_ᗱ.Ω_2, Thickness=3, Color=RGB(176, 176, 176))

# ==== cluster 옷ᑫᑭᗩᴥᕤᕦᗝᗱᗴᑫᑭᗩ옷ᔓᔕᔓᔕᗱᗴᑐᑕИNᗱᗴᴥᗱᗴΘᗝᗱᗴᴥᑎᗩᗯᴥᑎᑐᑕᑐᑕᑎᴥᗯᗩᑎᴥᗱᗴᗝΘᗱᗴᴥᗱᗴИNᑐᑕᗱᗴᔓᔕᔓᔕ옷ᗩᑫᑭᗱᗴᗝᕤᕦᴥᗩᑫᑭ옷: ⦿옷⦿ᑫᑭ⦿ᗩ⦿ᴥ⦿ᕤᕦ⦿◯⦿ᗝ⦿ᗱᗴ⦿ᑫᑭ⦿ᗩ⦿옷⦿ᔓᔕ⦿◯⦿ᔓᔕ⦿ᗱᗴ⦿ᑐᑕ⦿ИN⦿ᗱᗴ⦿ᴥ⦿ᗱᗴ⦿Θ⦿⊙⦿ᗝ⦿◯⦿ᗱᗴ⦿ᴥ⦿ᑎ⦿✤⦿ᗩ⦿ᗯ⦿ᴥ⦿ᑎ⦿ᑐᑕ⦿◌⦿◌⦿◌⦿◌⦿◌⦿◌⦿◌⦿◌⦿ᑐᑕ⦿ᑎ⦿ᴥ⦿ᗯ⦿ᗩ⦿✤⦿ᑎ⦿ᴥ⦿ᗱᗴ⦿◯⦿ᗝ⦿⊙⦿Θ⦿ᗱᗴ⦿ᴥ⦿ᗱᗴ⦿ИN⦿ᑐᑕ⦿ᗱᗴ⦿ᔓᔕ⦿◯⦿ᔓᔕ⦿옷⦿ᗩ⦿ᑫᑭ⦿ᗱᗴ⦿ᗝ⦿◯⦿ᕤᕦ⦿ᴥ⦿ᗩ⦿ᑫᑭ⦿옷⦿
x = ClusterInput()  # ^

x_2 = ClusterInput()  # ⇔

x_3 = ClusterInput()  # ↕
x_4 = ClusterInput()  # ·

null_item = NullItem(Item=x_4)  # -> NullFlags, InvalidFlags, Description
gate_not = GateNot(A=null_item.NullFlags)
stream_filter = StreamFilter(Gate=gate_not, Stream0="1/16", Stream1=x_4)

boolean = Boolean(x)
boolean_2 = Boolean(x_3)
x_5 = ClusterOutput(boolean_2)  # ↕

digit_scroller = DigitScroller(Scroller_Digits=12, Scroller_Prefix=" ", Scroller_Radix=11, Scroller_Value=87)  # disabled
create_material = CreateMaterial(Diffuse=RGB(222, 222, 222), Specular=RGB(0, 255, 255), Emission=RGB(0, 0, 0), Transparency=0.5, Shine=100)
create_material_2 = CreateMaterial(Diffuse=RGB(247, 247, 247), Specular=RGB(0, 255, 255), Emission=RGB(0, 0, 0), Transparency=0.5, Shine=100)
create_material_3 = CreateMaterial(Diffuse=RGB(176, 176, 176), Specular=RGB(0, 255, 255), Emission=RGB(0, 0, 0), Transparency=0.5, Shine=100)
x_6 = ClusterInput()  # ⊡
x_7 = ClusterInput()  # ¤
x_8 = ClusterInput()  # ◌
Ω = ClusterInput()  # Ω
curve = Curve(graft(Ω))
number = Number(x_7)
null_item_2 = NullItem(Item=number)  # -> NullFlags, InvalidFlags, Description
gate_not_2 = GateNot(A=null_item_2.NullFlags)
stream_filter_2 = StreamFilter(Gate=gate_not_2, Stream0="0", Stream1=number)
number_2 = Number(stream_filter_2)
x_9 = ClusterOutput(number_2)  # ¤
number_3 = Number(x_8)
curve_2 = Curve(curve)
control_points = ControlPoints(Curve=curve_2)  # -> Points, Weights, Knots
list_length = ListLength(List=control_points.Points)  # -> expr("X-1", Length)
curve_degree = CurveDegree(Curve=curve_2)
expression = Expression(A=list_length, B=curve_degree, Expression="A-B+1")
length = Length(Curve=curve_2)
curvature_graph = CurvatureGraph(Curve=curve_2, Density=1, Scale=digit_scroller)  # disabled
number_4 = Number(expression)
number_5 = Number(number_4)

curve_edit_points = CurveEditPoints(Curve=curve_2, Knots=True)  # -> Points, Tangents, Parameters
null_item_3 = NullItem(Item=number_3)  # -> NullFlags, InvalidFlags, Description
list_length_2 = ListLength(List=curve_edit_points.Points)  # -> expr("X-1", Length)
gate_not_3 = GateNot(A=null_item_3.NullFlags)
stream_filter_3 = StreamFilter(Gate=gate_not_3, Stream0=list_length_2, Stream1=number_3)
surface = Surface(x_6)
null_item_4 = NullItem(Item=surface)  # -> NullFlags, InvalidFlags, Description
gate_not_4 = GateNot(A=null_item_4.NullFlags)

pull_curve = PullCurve(Curve=curve_2, Surface=surface)
stream_filter_4 = StreamFilter(Gate=gate_not_4, Stream0=curve_2, Stream1=pull_curve)

number_6 = Number(stream_filter_3)
x_10 = ClusterOutput(number_6)  # ◌

create_material_4 = CreateMaterial(Diffuse=RGB(107, 107, 107), Specular=RGB(0, 255, 255), Emission=RGB(0, 0, 0), Transparency=0.5, Shine=100)
create_material_5 = CreateMaterial(Diffuse=RGB(133, 133, 133), Specular=RGB(0, 255, 255), Emission=RGB(0, 0, 0), Transparency=0.5, Shine=100)

create_material_6 = CreateMaterial(Diffuse=RGB(115, 115, 115), Specular=RGB(0, 255, 255), Emission=RGB(0, 0, 0), Transparency=0.5, Shine=100)
create_material_7 = CreateMaterial(Diffuse=RGB(140, 140, 140), Specular=RGB(0, 255, 255), Emission=RGB(0, 0, 0), Transparency=0.5, Shine=100)

create_material_8 = CreateMaterial(Diffuse=RGB(122, 122, 122), Specular=RGB(0, 255, 255), Emission=RGB(0, 0, 0), Transparency=0.5, Shine=100)
create_material_9 = CreateMaterial(Diffuse=RGB(148, 148, 148), Specular=RGB(0, 255, 255), Emission=RGB(0, 0, 0), Transparency=0.5, Shine=100)

create_material_10 = CreateMaterial(Diffuse=RGB(130, 130, 130), Specular=RGB(0, 255, 255), Emission=RGB(0, 0, 0), Transparency=0.5, Shine=100)
create_material_11 = CreateMaterial(Diffuse=RGB(156, 156, 156), Specular=RGB(0, 255, 255), Emission=RGB(0, 0, 0), Transparency=0.5, Shine=100)

create_material_12 = CreateMaterial(Diffuse=RGB(138, 138, 138), Specular=RGB(0, 255, 255), Emission=RGB(0, 0, 0), Transparency=0.5, Shine=100)
create_material_13 = CreateMaterial(Diffuse=RGB(163, 163, 163), Specular=RGB(0, 255, 255), Emission=RGB(0, 0, 0), Transparency=0.5, Shine=100)

create_material_14 = CreateMaterial(Diffuse=RGB(145, 145, 145), Specular=RGB(0, 255, 255), Emission=RGB(0, 0, 0), Transparency=0.5, Shine=100)
create_material_15 = CreateMaterial(Diffuse=RGB(171, 171, 171), Specular=RGB(0, 255, 255), Emission=RGB(0, 0, 0), Transparency=0.5, Shine=100)

create_material_16 = CreateMaterial(Diffuse=RGB(153, 153, 153), Specular=RGB(0, 255, 255), Emission=RGB(0, 0, 0), Transparency=0.5, Shine=100)
create_material_17 = CreateMaterial(Diffuse=RGB(178, 178, 178), Specular=RGB(0, 255, 255), Emission=RGB(0, 0, 0), Transparency=0.5, Shine=100)

create_material_18 = CreateMaterial(Diffuse=RGB(161, 161, 161), Specular=RGB(0, 255, 255), Emission=RGB(0, 0, 0), Transparency=0.5, Shine=100)
create_material_19 = CreateMaterial(Diffuse=RGB(186, 186, 186), Specular=RGB(0, 255, 255), Emission=RGB(0, 0, 0), Transparency=0.5, Shine=100)

create_material_20 = CreateMaterial(Diffuse=RGB(168, 168, 168), Specular=RGB(0, 255, 255), Emission=RGB(0, 0, 0), Transparency=0.5, Shine=100)
create_material_21 = CreateMaterial(Diffuse=RGB(194, 194, 194), Specular=RGB(0, 255, 255), Emission=RGB(0, 0, 0), Transparency=0.5, Shine=100)

create_material_22 = CreateMaterial(Diffuse=RGB(176, 176, 176), Specular=RGB(0, 255, 255), Emission=RGB(0, 0, 0), Transparency=0.5, Shine=100)
create_material_23 = CreateMaterial(Diffuse=RGB(201, 201, 201), Specular=RGB(0, 255, 255), Emission=RGB(0, 0, 0), Transparency=0.5, Shine=100)

create_material_24 = CreateMaterial(Diffuse=RGB(184, 184, 184), Specular=RGB(0, 255, 255), Emission=RGB(0, 0, 0), Transparency=0.5, Shine=100)
create_material_25 = CreateMaterial(Diffuse=RGB(209, 209, 209), Specular=RGB(0, 255, 255), Emission=RGB(0, 0, 0), Transparency=0.5, Shine=100)

create_material_26 = CreateMaterial(Diffuse=RGB(191, 191, 191), Specular=RGB(0, 255, 255), Emission=RGB(0, 0, 0), Transparency=0.5, Shine=100)
create_material_27 = CreateMaterial(Diffuse=RGB(217, 217, 217), Specular=RGB(0, 255, 255), Emission=RGB(0, 0, 0), Transparency=0.5, Shine=100)

create_material_28 = CreateMaterial(Diffuse=RGB(199, 199, 199), Specular=RGB(0, 255, 255), Emission=RGB(0, 0, 0), Transparency=0.5, Shine=100)
create_material_29 = CreateMaterial(Diffuse=RGB(224, 224, 224), Specular=RGB(0, 255, 255), Emission=RGB(0, 0, 0), Transparency=0.5, Shine=100)

create_material_30 = CreateMaterial(Diffuse=RGB(207, 207, 207), Specular=RGB(0, 255, 255), Emission=RGB(0, 0, 0), Transparency=0.5, Shine=100)
create_material_31 = CreateMaterial(Diffuse=RGB(232, 232, 232), Specular=RGB(0, 255, 255), Emission=RGB(0, 0, 0), Transparency=0.5, Shine=100)

create_material_32 = CreateMaterial(Diffuse=RGB(214, 214, 214), Specular=RGB(0, 255, 255), Emission=RGB(0, 0, 0), Transparency=0.5, Shine=100)
create_material_33 = CreateMaterial(Diffuse=RGB(240, 240, 240), Specular=RGB(0, 255, 255), Emission=RGB(0, 0, 0), Transparency=0.5, Shine=100)

divide_curve = DivideCurve(Curve=curve_2, Count=number_6, Kinks=False)  # -> Points, Tangents, Parameters
curvature = Curvature(Curve=curve_2, Parameter=divide_curve.Parameters)  # -> Point, Curvature, Curvature_2
deconstruct_arc = DeconstructArc(Arc=curvature.Curvature_2)  # -> BasePlane, Radius, Angle
line = Line(StartPoint=curvature.Point, EndPoint=deconstruct_arc.BasePlane)
line_sdl = LineSDL(Start=divide_curve.Points, Direction=divide_curve.Tangents, Length=-1)
rotate = Rotate(Vector=curvature.Curvature, Axis=line_sdl, Angle=degrees(number_2))
one_over_x = OneOverX(Value=deconstruct_arc.Radius)
quick_graph = QuickGraph(one_over_x, SortOrder=0)
bounds = Bounds(Numbers=one_over_x)
remap_numbers = RemapNumbers(Value=one_over_x, Source=bounds, Target=Domain(0, 1))  # -> Mapped, Clipped
format = Format(Format="{0:R}", Culture=127, Data0=one_over_x)  # disabled
panel = Panel(format)
custom_preview = CustomPreview(Geometry=stream_filter_4, Material=create_material_3)
multiplication = Multiplication(A=length, B=remap_numbers.Mapped)
multiplication_2 = Multiplication(A=multiplication, B=stream_filter)
x_11 = ClusterOutput(surface)  # ⊡
Ω_2 = ClusterOutput(stream_filter_4)  # Ω

replace_nulls = ReplaceNulls(Items=one_over_x, Replacements=0)  # -> Items, Count
relative_differences = RelativeDifferences(Values=replace_nulls.Items)
shift_list = ShiftList(List=relative_differences, Shift=1, Wrap=False)

replace_nulls_2 = ReplaceNulls(Items=shift_list, Replacements=0)  # -> Items, Count
relative_differences_2 = RelativeDifferences(Values=replace_nulls_2.Items)
shift_list_2 = ShiftList(List=relative_differences_2, Shift=1, Wrap=False)

replace_nulls_3 = ReplaceNulls(Items=shift_list_2, Replacements=0)  # -> Items, Count
relative_differences_3 = RelativeDifferences(Values=replace_nulls_3.Items)
shift_list_3 = ShiftList(List=relative_differences_3, Shift=1, Wrap=False)

replace_nulls_4 = ReplaceNulls(Items=shift_list_3, Replacements=0)  # -> Items, Count
relative_differences_4 = RelativeDifferences(Values=replace_nulls_4.Items)
shift_list_4 = ShiftList(List=relative_differences_4, Shift=1, Wrap=False)

replace_nulls_5 = ReplaceNulls(Items=shift_list_4, Replacements=0)  # -> Items, Count
relative_differences_5 = RelativeDifferences(Values=replace_nulls_5.Items)
shift_list_5 = ShiftList(List=relative_differences_5, Shift=1, Wrap=False)

expression_2 = Expression(O=shift_list_5, Expression="FORMAT(\"{0:R}\",O)")  # disabled
format_2 = Format(Format="{0:R}", Culture=127, Data0=shift_list_5)  # disabled
panel_2 = Panel(format_2)

replace_nulls_6 = ReplaceNulls(Items=shift_list_5, Replacements=0)  # -> Items, Count
relative_differences_6 = RelativeDifferences(Values=replace_nulls_6.Items)
shift_list_6 = ShiftList(List=relative_differences_6, Shift=1, Wrap=False)

replace_nulls_7 = ReplaceNulls(Items=shift_list_6, Replacements=0)  # -> Items, Count
relative_differences_7 = RelativeDifferences(Values=replace_nulls_7.Items)
shift_list_7 = ShiftList(List=relative_differences_7, Shift=1, Wrap=False)

replace_nulls_8 = ReplaceNulls(Items=shift_list_7, Replacements=0)  # -> Items, Count
relative_differences_8 = RelativeDifferences(Values=replace_nulls_8.Items)
shift_list_8 = ShiftList(List=relative_differences_8, Shift=1, Wrap=False)

replace_nulls_9 = ReplaceNulls(Items=shift_list_8, Replacements=0)  # -> Items, Count
relative_differences_9 = RelativeDifferences(Values=replace_nulls_9.Items)
shift_list_9 = ShiftList(List=relative_differences_9, Shift=1, Wrap=False)

replace_nulls_10 = ReplaceNulls(Items=shift_list_9, Replacements=0)  # -> Items, Count
relative_differences_10 = RelativeDifferences(Values=replace_nulls_10.Items)
shift_list_10 = ShiftList(List=relative_differences_10, Shift=1, Wrap=False)

replace_nulls_11 = ReplaceNulls(Items=shift_list_10, Replacements=0)  # -> Items, Count
relative_differences_11 = RelativeDifferences(Values=replace_nulls_11.Items)
shift_list_11 = ShiftList(List=relative_differences_11, Shift=1, Wrap=False)

replace_nulls_12 = ReplaceNulls(Items=shift_list_11, Replacements=0)  # -> Items, Count
relative_differences_12 = RelativeDifferences(Values=replace_nulls_12.Items)
shift_list_12 = ShiftList(List=relative_differences_12, Shift=1, Wrap=False)

replace_nulls_13 = ReplaceNulls(Items=shift_list_12, Replacements=0)  # -> Items, Count
relative_differences_13 = RelativeDifferences(Values=replace_nulls_13.Items)
shift_list_13 = ShiftList(List=relative_differences_13, Shift=1, Wrap=False)

replace_nulls_14 = ReplaceNulls(Items=shift_list_13, Replacements=0)  # -> Items, Count
relative_differences_14 = RelativeDifferences(Values=replace_nulls_14.Items)
shift_list_14 = ShiftList(List=relative_differences_14, Shift=1, Wrap=False)

replace_nulls_15 = ReplaceNulls(Items=shift_list_14, Replacements=0)  # -> Items, Count
relative_differences_15 = RelativeDifferences(Values=replace_nulls_15.Items)
shift_list_15 = ShiftList(List=relative_differences_15, Shift=1, Wrap=False)

null_item_5 = NullItem(Item=x_4)  # -> NullFlags, InvalidFlags, Description
gate_not_5 = GateNot(A=null_item_5.NullFlags)
stream_filter_5 = StreamFilter(Gate=gate_not_5, Stream1=curvature.Point)

format_3 = Format(Format="{0:R}", Culture=127, Data0=shift_list_15)  # disabled
panel_3 = Panel(format_3)

format_4 = Format(Format="{0:R}", Culture=127, Data0=shift_list_14)  # disabled
panel_4 = Panel(format_4)

format_5 = Format(Format="{0:R}", Culture=127, Data0=shift_list_13)  # disabled
panel_5 = Panel(format_5)

format_6 = Format(Format="{0:R}", Culture=127, Data0=shift_list_12)  # disabled
panel_6 = Panel(format_6)

format_7 = Format(Format="{0:R}", Culture=127, Data0=shift_list_11)  # disabled
panel_7 = Panel(format_7)

format_8 = Format(Format="{0:R}", Culture=127, Data0=shift_list_10)  # disabled
panel_8 = Panel(format_8)

format_9 = Format(Format="{0:R}", Culture=127, Data0=shift_list_9)  # disabled
panel_9 = Panel(format_9)

format_10 = Format(Format="{0:R}", Culture=127, Data0=shift_list_8)  # disabled
panel_10 = Panel(format_10)

format_11 = Format(Format="{0:R}", Culture=127, Data0=shift_list_7)  # disabled
panel_11 = Panel(format_11)

format_12 = Format(Format="{0:R}", Culture=127, Data0=shift_list_6)  # disabled
panel_12 = Panel(format_12)

format_13 = Format(Format="{0:R}", Culture=127, Data0=shift_list_4)  # disabled
panel_13 = Panel(format_13)

format_14 = Format(Format="{0:R}", Culture=127, Data0=shift_list_3)  # disabled
panel_14 = Panel(format_14)

format_15 = Format(Format="{0:R}", Culture=127, Data0=shift_list_2)  # disabled
panel_15 = Panel(format_15)

format_16 = Format(Format="{0:R}", Culture=127, Data0=shift_list)  # disabled
panel_16 = Panel(format_16)

format_17 = Format(Format="{0:R}", Culture=127, Data0=deconstruct_arc.Radius)  # disabled
panel_17 = Panel(format_17)

quick_graph_2 = QuickGraph(shift_list_15, SortOrder=0)

quick_graph_3 = QuickGraph(shift_list_14, SortOrder=0)

quick_graph_4 = QuickGraph(shift_list_13, SortOrder=0)

quick_graph_5 = QuickGraph(shift_list_12, SortOrder=0)

quick_graph_6 = QuickGraph(shift_list_11, SortOrder=0)

quick_graph_7 = QuickGraph(shift_list_10, SortOrder=0)

quick_graph_8 = QuickGraph(shift_list_9, SortOrder=0)

quick_graph_9 = QuickGraph(shift_list_8, SortOrder=0)

quick_graph_10 = QuickGraph(shift_list_7, SortOrder=0)

quick_graph_11 = QuickGraph(shift_list_6, SortOrder=0)

quick_graph_12 = QuickGraph(shift_list_5, SortOrder=0)

quick_graph_13 = QuickGraph(shift_list_4, SortOrder=0)

quick_graph_14 = QuickGraph(shift_list_3, SortOrder=0)

quick_graph_15 = QuickGraph(shift_list_2, SortOrder=0)

quick_graph_16 = QuickGraph(shift_list, SortOrder=0)

bounds_2 = Bounds(Numbers=shift_list_15)
remap_numbers_2 = RemapNumbers(Value=shift_list_15, Source=bounds_2, Target=Domain(-1, 1))  # -> Mapped, Clipped
x_12 = ClusterInput()  # ················
multiplication_3 = Multiplication(A=length, B=remap_numbers_2.Mapped)

null_item_6 = NullItem(Item=x_12)  # -> NullFlags, InvalidFlags, Description
gate_not_6 = GateNot(A=null_item_6.NullFlags)
stream_filter_6 = StreamFilter(Gate=gate_not_6, Stream0="1/16", Stream1=x_12)

multiplication_4 = Multiplication(A=multiplication_3, B=stream_filter_6)

null_item_7 = NullItem(Item=x_12)  # -> NullFlags, InvalidFlags, Description
gate_not_7 = GateNot(A=null_item_7.NullFlags)

bounds_3 = Bounds(Numbers=shift_list_14)
remap_numbers_3 = RemapNumbers(Value=shift_list_14, Source=bounds_3, Target=Domain(-1, 1))  # -> Mapped, Clipped
x_13 = ClusterInput()  # ···············
multiplication_5 = Multiplication(A=length, B=remap_numbers_3.Mapped)

null_item_8 = NullItem(Item=x_13)  # -> NullFlags, InvalidFlags, Description
gate_not_8 = GateNot(A=null_item_8.NullFlags)
stream_filter_7 = StreamFilter(Gate=gate_not_8, Stream0="1/16", Stream1=x_13)

multiplication_6 = Multiplication(A=multiplication_5, B=stream_filter_7)

null_item_9 = NullItem(Item=x_13)  # -> NullFlags, InvalidFlags, Description
gate_not_9 = GateNot(A=null_item_9.NullFlags)

bounds_4 = Bounds(Numbers=shift_list_13)
remap_numbers_4 = RemapNumbers(Value=shift_list_13, Source=bounds_4, Target=Domain(-1, 1))  # -> Mapped, Clipped
x_14 = ClusterInput()  # ··············
multiplication_7 = Multiplication(A=length, B=remap_numbers_4.Mapped)

null_item_10 = NullItem(Item=x_14)  # -> NullFlags, InvalidFlags, Description
gate_not_10 = GateNot(A=null_item_10.NullFlags)
stream_filter_8 = StreamFilter(Gate=gate_not_10, Stream0="1/16", Stream1=x_14)

multiplication_8 = Multiplication(A=multiplication_7, B=stream_filter_8)

null_item_11 = NullItem(Item=x_14)  # -> NullFlags, InvalidFlags, Description
gate_not_11 = GateNot(A=null_item_11.NullFlags)

bounds_5 = Bounds(Numbers=shift_list_12)
remap_numbers_5 = RemapNumbers(Value=shift_list_12, Source=bounds_5, Target=Domain(-1, 1))  # -> Mapped, Clipped
x_15 = ClusterInput()  # ·············
multiplication_9 = Multiplication(A=length, B=remap_numbers_5.Mapped)

null_item_12 = NullItem(Item=x_15)  # -> NullFlags, InvalidFlags, Description
gate_not_12 = GateNot(A=null_item_12.NullFlags)
stream_filter_9 = StreamFilter(Gate=gate_not_12, Stream0="1/16", Stream1=x_15)

multiplication_10 = Multiplication(A=multiplication_9, B=stream_filter_9)

null_item_13 = NullItem(Item=x_15)  # -> NullFlags, InvalidFlags, Description
gate_not_13 = GateNot(A=null_item_13.NullFlags)

bounds_6 = Bounds(Numbers=shift_list_11)
remap_numbers_6 = RemapNumbers(Value=shift_list_11, Source=bounds_6, Target=Domain(-1, 1))  # -> Mapped, Clipped
x_16 = ClusterInput()  # ············
multiplication_11 = Multiplication(A=length, B=remap_numbers_6.Mapped)

null_item_14 = NullItem(Item=x_16)  # -> NullFlags, InvalidFlags, Description
gate_not_14 = GateNot(A=null_item_14.NullFlags)
stream_filter_10 = StreamFilter(Gate=gate_not_14, Stream0="1/16", Stream1=x_16)

multiplication_12 = Multiplication(A=multiplication_11, B=stream_filter_10)

null_item_15 = NullItem(Item=x_16)  # -> NullFlags, InvalidFlags, Description
gate_not_15 = GateNot(A=null_item_15.NullFlags)

bounds_7 = Bounds(Numbers=shift_list_10)
remap_numbers_7 = RemapNumbers(Value=shift_list_10, Source=bounds_7, Target=Domain(-1, 1))  # -> Mapped, Clipped
x_17 = ClusterInput()  # ···········
multiplication_13 = Multiplication(A=length, B=remap_numbers_7.Mapped)

null_item_16 = NullItem(Item=x_17)  # -> NullFlags, InvalidFlags, Description
gate_not_16 = GateNot(A=null_item_16.NullFlags)
stream_filter_11 = StreamFilter(Gate=gate_not_16, Stream0="1/16", Stream1=x_17)

multiplication_14 = Multiplication(A=multiplication_13, B=stream_filter_11)

null_item_17 = NullItem(Item=x_17)  # -> NullFlags, InvalidFlags, Description
gate_not_17 = GateNot(A=null_item_17.NullFlags)

bounds_8 = Bounds(Numbers=shift_list_9)
remap_numbers_8 = RemapNumbers(Value=shift_list_9, Source=bounds_8, Target=Domain(-1, 1))  # -> Mapped, Clipped
multiplication_15 = Multiplication(A=length, B=remap_numbers_8.Mapped)
x_18 = ClusterInput()  # ··········

null_item_18 = NullItem(Item=x_18)  # -> NullFlags, InvalidFlags, Description
gate_not_18 = GateNot(A=null_item_18.NullFlags)
stream_filter_12 = StreamFilter(Gate=gate_not_18, Stream0="1/16", Stream1=x_18)

multiplication_16 = Multiplication(A=multiplication_15, B=stream_filter_12)

null_item_19 = NullItem(Item=x_18)  # -> NullFlags, InvalidFlags, Description
gate_not_19 = GateNot(A=null_item_19.NullFlags)

bounds_9 = Bounds(Numbers=shift_list_8)
remap_numbers_9 = RemapNumbers(Value=shift_list_8, Source=bounds_9, Target=Domain(-1, 1))  # -> Mapped, Clipped
multiplication_17 = Multiplication(A=length, B=remap_numbers_9.Mapped)
x_19 = ClusterInput()  # ·········

null_item_20 = NullItem(Item=x_19)  # -> NullFlags, InvalidFlags, Description
gate_not_20 = GateNot(A=null_item_20.NullFlags)
stream_filter_13 = StreamFilter(Gate=gate_not_20, Stream0="1/16", Stream1=x_19)

multiplication_18 = Multiplication(A=multiplication_17, B=stream_filter_13)

null_item_21 = NullItem(Item=x_19)  # -> NullFlags, InvalidFlags, Description
gate_not_21 = GateNot(A=null_item_21.NullFlags)

bounds_10 = Bounds(Numbers=shift_list_7)
remap_numbers_10 = RemapNumbers(Value=shift_list_7, Source=bounds_10, Target=Domain(-1, 1))  # -> Mapped, Clipped
multiplication_19 = Multiplication(A=length, B=remap_numbers_10.Mapped)
x_20 = ClusterInput()  # ········

null_item_22 = NullItem(Item=x_20)  # -> NullFlags, InvalidFlags, Description
gate_not_22 = GateNot(A=null_item_22.NullFlags)
stream_filter_14 = StreamFilter(Gate=gate_not_22, Stream0="1/16", Stream1=x_20)

multiplication_20 = Multiplication(A=multiplication_19, B=stream_filter_14)

null_item_23 = NullItem(Item=x_20)  # -> NullFlags, InvalidFlags, Description
gate_not_23 = GateNot(A=null_item_23.NullFlags)

bounds_11 = Bounds(Numbers=shift_list_6)
remap_numbers_11 = RemapNumbers(Value=shift_list_6, Source=bounds_11, Target=Domain(-1, 1))  # -> Mapped, Clipped
multiplication_21 = Multiplication(A=length, B=remap_numbers_11.Mapped)
x_21 = ClusterInput()  # ·······

null_item_24 = NullItem(Item=x_21)  # -> NullFlags, InvalidFlags, Description
gate_not_24 = GateNot(A=null_item_24.NullFlags)
stream_filter_15 = StreamFilter(Gate=gate_not_24, Stream0="1/16", Stream1=x_21)

multiplication_22 = Multiplication(A=multiplication_21, B=stream_filter_15)

null_item_25 = NullItem(Item=x_21)  # -> NullFlags, InvalidFlags, Description
gate_not_25 = GateNot(A=null_item_25.NullFlags)

bounds_12 = Bounds(Numbers=shift_list_5)
remap_numbers_12 = RemapNumbers(Value=shift_list_5, Source=bounds_12, Target=Domain(-1, 1))  # -> Mapped, Clipped
multiplication_23 = Multiplication(A=length, B=remap_numbers_12.Mapped)
x_22 = ClusterInput()  # ······

null_item_26 = NullItem(Item=x_22)  # -> NullFlags, InvalidFlags, Description
gate_not_26 = GateNot(A=null_item_26.NullFlags)
stream_filter_16 = StreamFilter(Gate=gate_not_26, Stream0="1/16", Stream1=x_22)

multiplication_24 = Multiplication(A=multiplication_23, B=stream_filter_16)

null_item_27 = NullItem(Item=x_22)  # -> NullFlags, InvalidFlags, Description
gate_not_27 = GateNot(A=null_item_27.NullFlags)

bounds_13 = Bounds(Numbers=shift_list_4)
remap_numbers_13 = RemapNumbers(Value=shift_list_4, Source=bounds_13, Target=Domain(-1, 1))  # -> Mapped, Clipped
multiplication_25 = Multiplication(A=length, B=remap_numbers_13.Mapped)
x_23 = ClusterInput()  # ·····

null_item_28 = NullItem(Item=x_23)  # -> NullFlags, InvalidFlags, Description
gate_not_28 = GateNot(A=null_item_28.NullFlags)
stream_filter_17 = StreamFilter(Gate=gate_not_28, Stream0="1/16", Stream1=x_23)

multiplication_26 = Multiplication(A=multiplication_25, B=stream_filter_17)

null_item_29 = NullItem(Item=x_23)  # -> NullFlags, InvalidFlags, Description
gate_not_29 = GateNot(A=null_item_29.NullFlags)

bounds_14 = Bounds(Numbers=shift_list_3)
remap_numbers_14 = RemapNumbers(Value=shift_list_3, Source=bounds_14, Target=Domain(-1, 1))  # -> Mapped, Clipped
multiplication_27 = Multiplication(A=length, B=remap_numbers_14.Mapped)
x_24 = ClusterInput()  # ····

null_item_30 = NullItem(Item=x_24)  # -> NullFlags, InvalidFlags, Description
gate_not_30 = GateNot(A=null_item_30.NullFlags)
stream_filter_18 = StreamFilter(Gate=gate_not_30, Stream0="1/16", Stream1=x_24)

multiplication_28 = Multiplication(A=multiplication_27, B=stream_filter_18)

null_item_31 = NullItem(Item=x_24)  # -> NullFlags, InvalidFlags, Description
gate_not_31 = GateNot(A=null_item_31.NullFlags)

bounds_15 = Bounds(Numbers=shift_list_2)
remap_numbers_15 = RemapNumbers(Value=shift_list_2, Source=bounds_15, Target=Domain(-1, 1))  # -> Mapped, Clipped
multiplication_29 = Multiplication(A=length, B=remap_numbers_15.Mapped)
x_25 = ClusterInput()  # ···

null_item_32 = NullItem(Item=x_25)  # -> NullFlags, InvalidFlags, Description
gate_not_32 = GateNot(A=null_item_32.NullFlags)
stream_filter_19 = StreamFilter(Gate=gate_not_32, Stream0="1/16", Stream1=x_25)

multiplication_30 = Multiplication(A=multiplication_29, B=stream_filter_19)

null_item_33 = NullItem(Item=x_25)  # -> NullFlags, InvalidFlags, Description
gate_not_33 = GateNot(A=null_item_33.NullFlags)

bounds_16 = Bounds(Numbers=shift_list)
remap_numbers_16 = RemapNumbers(Value=shift_list, Source=bounds_16, Target=Domain(-1, 1))  # -> Mapped, Clipped
multiplication_31 = Multiplication(A=length, B=remap_numbers_16.Mapped)
x_26 = ClusterInput()  # ··

null_item_34 = NullItem(Item=x_26)  # -> NullFlags, InvalidFlags, Description
gate_not_34 = GateNot(A=null_item_34.NullFlags)
stream_filter_20 = StreamFilter(Gate=gate_not_34, Stream0="1/16", Stream1=x_26)

multiplication_32 = Multiplication(A=multiplication_31, B=stream_filter_20)

null_item_35 = NullItem(Item=x_26)  # -> NullFlags, InvalidFlags, Description
gate_not_35 = GateNot(A=null_item_35.NullFlags)

line_sdl_2 = LineSDL(Start=stream_filter_5, Direction=rotate, Length=expr("-X", multiplication_2))

pull_curve_2 = PullCurve(Curve=line_sdl_2, Surface=surface)  # disabled

end_points = EndPoints(Curve=line_sdl_2)  # -> Start, End
pull_point = PullPoint(Point=end_points.Start, Geometry=surface, ClosestOnly=True)  # -> ClosestPoint, Distance
pull_point_2 = PullPoint(Point=end_points.End, Geometry=surface, ClosestOnly=True)  # -> ClosestPoint, Distance
line_2 = Line(StartPoint=pull_point.ClosestPoint, EndPoint=pull_point_2.ClosestPoint)

stream_filter_21 = StreamFilter(Gate=gate_not_4, Stream0=line_sdl_2, Stream1=line_2)

evaluate_length = EvaluateLength(Curve=stream_filter_21, Length=1, Normalized=True)  # -> Point, Tangent, Parameter
custom_preview_2 = CustomPreview(Geometry=stream_filter_21, Material=create_material_2)
I = ClusterOutput(stream_filter_21)  # I

pull_point_3 = PullPoint(Point=evaluate_length.Point, Geometry=surface, ClosestOnly=True)  # -> ClosestPoint, Distance
stream_filter_22 = StreamFilter(Gate=gate_not_4, Stream0=evaluate_length.Point, Stream1=pull_point_3.ClosestPoint)

interpolate = Interpolate(Vertices=stream_filter_22, Degree=1, Periodic=False, KnotStyle=2)  # -> Curve, Length, Domain
curve_3 = Curve(interpolate.Curve)
custom_preview_3 = CustomPreview(Geometry=curve_3, Material=create_material)

explode = Explode(Curve=curve_3, Recursive=True)  # -> Segments, Vertices
evaluate_length_2 = EvaluateLength(Curve=explode.Segments, Length=0.5, Normalized=True)  # -> Point, Tangent, Parameter
curve_closest_point = CurveClosestPoint(Point=evaluate_length_2.Point, Curve=curve_2)  # -> Point, Parameter, Distance
line_3 = Line(StartPoint=curve_closest_point.Point, EndPoint=evaluate_length_2.Point)

stream_filter_23 = StreamFilter(Gate=gate_not_35, Stream1=evaluate_length_2.Point)

line_sdl_3 = LineSDL(Start=stream_filter_23, Direction=line_3, Length=expr("ABS(X)", multiplication_32))

pull_curve_3 = PullCurve(Curve=line_sdl_3, Surface=surface)  # disabled

end_points_2 = EndPoints(Curve=line_sdl_3)  # -> Start, End
pull_point_4 = PullPoint(Point=end_points_2.Start, Geometry=surface, ClosestOnly=True)  # -> ClosestPoint, Distance
pull_point_5 = PullPoint(Point=end_points_2.End, Geometry=surface, ClosestOnly=True)  # -> ClosestPoint, Distance
line_4 = Line(StartPoint=pull_point_4.ClosestPoint, EndPoint=pull_point_5.ClosestPoint)

stream_filter_24 = StreamFilter(Gate=gate_not_4, Stream0=line_sdl_3, Stream1=line_4)

evaluate_length_3 = EvaluateLength(Curve=stream_filter_24, Length=1, Normalized=True)  # -> Point, Tangent, Parameter
custom_preview_4 = CustomPreview(Geometry=stream_filter_24, Material=create_material_33)
ii = ClusterOutput(stream_filter_24)  # II

pull_point_6 = PullPoint(Point=evaluate_length_3.Point, Geometry=surface, ClosestOnly=True)  # -> ClosestPoint, Distance
stream_filter_25 = StreamFilter(Gate=gate_not_4, Stream0=evaluate_length_3.Point, Stream1=pull_point_6.ClosestPoint)

interpolate_2 = Interpolate(Vertices=stream_filter_25, Degree=1, Periodic=False, KnotStyle=2)  # -> Curve, Length, Domain
custom_preview_5 = CustomPreview(Geometry=interpolate_2.Curve, Material=create_material_32)

explode_2 = Explode(Curve=interpolate_2.Curve, Recursive=True)  # -> Segments, Vertices
evaluate_length_4 = EvaluateLength(Curve=explode_2.Segments, Length=0.5, Normalized=True)  # -> Point, Tangent, Parameter
curve_closest_point_2 = CurveClosestPoint(Point=evaluate_length_4.Point, Curve=curve_2)  # -> Point, Parameter, Distance
line_5 = Line(StartPoint=curve_closest_point_2.Point, EndPoint=evaluate_length_4.Point)

stream_filter_26 = StreamFilter(Gate=gate_not_33, Stream1=evaluate_length_4.Point)

line_sdl_4 = LineSDL(Start=stream_filter_26, Direction=line_5, Length=expr("ABS(X)", multiplication_30))

pull_curve_4 = PullCurve(Curve=line_sdl_4, Surface=surface)  # disabled

end_points_3 = EndPoints(Curve=line_sdl_4)  # -> Start, End
pull_point_7 = PullPoint(Point=end_points_3.Start, Geometry=surface, ClosestOnly=True)  # -> ClosestPoint, Distance
pull_point_8 = PullPoint(Point=end_points_3.End, Geometry=surface, ClosestOnly=True)  # -> ClosestPoint, Distance
line_6 = Line(StartPoint=pull_point_7.ClosestPoint, EndPoint=pull_point_8.ClosestPoint)

stream_filter_27 = StreamFilter(Gate=gate_not_4, Stream0=line_sdl_4, Stream1=line_6)

evaluate_length_5 = EvaluateLength(Curve=stream_filter_27, Length=1, Normalized=True)  # -> Point, Tangent, Parameter
custom_preview_6 = CustomPreview(Geometry=stream_filter_27, Material=create_material_31)
iii = ClusterOutput(stream_filter_27)  # III

pull_point_9 = PullPoint(Point=evaluate_length_5.Point, Geometry=surface, ClosestOnly=True)  # -> ClosestPoint, Distance
stream_filter_28 = StreamFilter(Gate=gate_not_4, Stream0=evaluate_length_5.Point, Stream1=pull_point_9.ClosestPoint)

interpolate_3 = Interpolate(Vertices=stream_filter_28, Degree=1, Periodic=False, KnotStyle=2)  # -> Curve, Length, Domain
custom_preview_7 = CustomPreview(Geometry=interpolate_3.Curve, Material=create_material_30)

explode_3 = Explode(Curve=interpolate_3.Curve, Recursive=True)  # -> Segments, Vertices
evaluate_length_6 = EvaluateLength(Curve=explode_3.Segments, Length=0.5, Normalized=True)  # -> Point, Tangent, Parameter
curve_closest_point_3 = CurveClosestPoint(Point=evaluate_length_6.Point, Curve=curve_2)  # -> Point, Parameter, Distance
line_7 = Line(StartPoint=curve_closest_point_3.Point, EndPoint=evaluate_length_6.Point)

stream_filter_29 = StreamFilter(Gate=gate_not_31, Stream1=evaluate_length_6.Point)

line_sdl_5 = LineSDL(Start=stream_filter_29, Direction=line_7, Length=expr("ABS(X)", multiplication_28))

pull_curve_5 = PullCurve(Curve=line_sdl_5, Surface=surface)  # disabled

end_points_4 = EndPoints(Curve=line_sdl_5)  # -> Start, End
pull_point_10 = PullPoint(Point=end_points_4.Start, Geometry=surface, ClosestOnly=True)  # -> ClosestPoint, Distance
pull_point_11 = PullPoint(Point=end_points_4.End, Geometry=surface, ClosestOnly=True)  # -> ClosestPoint, Distance
line_8 = Line(StartPoint=pull_point_10.ClosestPoint, EndPoint=pull_point_11.ClosestPoint)

stream_filter_30 = StreamFilter(Gate=gate_not_4, Stream0=line_sdl_5, Stream1=line_8)

evaluate_length_7 = EvaluateLength(Curve=stream_filter_30, Length=1, Normalized=True)  # -> Point, Tangent, Parameter
custom_preview_8 = CustomPreview(Geometry=stream_filter_30, Material=create_material_29)
iiii = ClusterOutput(stream_filter_30)  # IIII

pull_point_12 = PullPoint(Point=evaluate_length_7.Point, Geometry=surface, ClosestOnly=True)  # -> ClosestPoint, Distance
stream_filter_31 = StreamFilter(Gate=gate_not_4, Stream0=evaluate_length_7.Point, Stream1=pull_point_12.ClosestPoint)

interpolate_4 = Interpolate(Vertices=stream_filter_31, Degree=1, Periodic=False, KnotStyle=2)  # -> Curve, Length, Domain
custom_preview_9 = CustomPreview(Geometry=interpolate_4.Curve, Material=create_material_28)

explode_4 = Explode(Curve=interpolate_4.Curve, Recursive=True)  # -> Segments, Vertices
evaluate_length_8 = EvaluateLength(Curve=explode_4.Segments, Length=0.5, Normalized=True)  # -> Point, Tangent, Parameter
curve_closest_point_4 = CurveClosestPoint(Point=evaluate_length_8.Point, Curve=curve_2)  # -> Point, Parameter, Distance
line_9 = Line(StartPoint=curve_closest_point_4.Point, EndPoint=evaluate_length_8.Point)

stream_filter_32 = StreamFilter(Gate=gate_not_29, Stream1=evaluate_length_8.Point)

line_sdl_6 = LineSDL(Start=stream_filter_32, Direction=line_9, Length=expr("ABS(X)", multiplication_26))

end_points_5 = EndPoints(Curve=line_sdl_6)  # -> Start, End
pull_point_13 = PullPoint(Point=end_points_5.Start, Geometry=surface, ClosestOnly=True)  # -> ClosestPoint, Distance
pull_point_14 = PullPoint(Point=end_points_5.End, Geometry=surface, ClosestOnly=True)  # -> ClosestPoint, Distance
line_10 = Line(StartPoint=pull_point_13.ClosestPoint, EndPoint=pull_point_14.ClosestPoint)

stream_filter_33 = StreamFilter(Gate=gate_not_4, Stream0=line_sdl_6, Stream1=line_10)

evaluate_length_9 = EvaluateLength(Curve=stream_filter_33, Length=1, Normalized=True)  # -> Point, Tangent, Parameter
custom_preview_10 = CustomPreview(Geometry=stream_filter_33, Material=create_material_27)
iiiii = ClusterOutput(stream_filter_33)  # IIIII

pull_point_15 = PullPoint(Point=evaluate_length_9.Point, Geometry=surface, ClosestOnly=True)  # -> ClosestPoint, Distance
stream_filter_34 = StreamFilter(Gate=gate_not_4, Stream0=evaluate_length_9.Point, Stream1=pull_point_15.ClosestPoint)

interpolate_5 = Interpolate(Vertices=stream_filter_34, Degree=1, Periodic=False, KnotStyle=2)  # -> Curve, Length, Domain
custom_preview_11 = CustomPreview(Geometry=interpolate_5.Curve, Material=create_material_26)

explode_5 = Explode(Curve=interpolate_5.Curve, Recursive=True)  # -> Segments, Vertices
evaluate_length_10 = EvaluateLength(Curve=explode_5.Segments, Length=0.5, Normalized=True)  # -> Point, Tangent, Parameter
curve_closest_point_5 = CurveClosestPoint(Point=evaluate_length_10.Point, Curve=curve_2)  # -> Point, Parameter, Distance
line_11 = Line(StartPoint=curve_closest_point_5.Point, EndPoint=evaluate_length_10.Point)

stream_filter_35 = StreamFilter(Gate=gate_not_27, Stream1=evaluate_length_10.Point)

line_sdl_7 = LineSDL(Start=stream_filter_35, Direction=line_11, Length=expr("ABS(X)", multiplication_24))

end_points_6 = EndPoints(Curve=line_sdl_7)  # -> Start, End
pull_point_16 = PullPoint(Point=end_points_6.Start, Geometry=surface, ClosestOnly=True)  # -> ClosestPoint, Distance
pull_point_17 = PullPoint(Point=end_points_6.End, Geometry=surface, ClosestOnly=True)  # -> ClosestPoint, Distance
line_12 = Line(StartPoint=pull_point_16.ClosestPoint, EndPoint=pull_point_17.ClosestPoint)
stream_filter_36 = StreamFilter(Gate=gate_not_4, Stream0=line_sdl_7, Stream1=line_12)

evaluate_length_11 = EvaluateLength(Curve=stream_filter_36, Length=1, Normalized=True)  # -> Point, Tangent, Parameter
custom_preview_12 = CustomPreview(Geometry=stream_filter_36, Material=create_material_25)
iiiiii = ClusterOutput(stream_filter_36)  # IIIIII

pull_point_18 = PullPoint(Point=evaluate_length_11.Point, Geometry=surface, ClosestOnly=True)  # -> ClosestPoint, Distance
stream_filter_37 = StreamFilter(Gate=gate_not_4, Stream0=evaluate_length_11.Point, Stream1=pull_point_18.ClosestPoint)

interpolate_6 = Interpolate(Vertices=stream_filter_37, Degree=1, Periodic=False, KnotStyle=2)  # -> Curve, Length, Domain
custom_preview_13 = CustomPreview(Geometry=interpolate_6.Curve, Material=create_material_24)

explode_6 = Explode(Curve=interpolate_6.Curve, Recursive=True)  # -> Segments, Vertices
evaluate_length_12 = EvaluateLength(Curve=explode_6.Segments, Length=0.5, Normalized=True)  # -> Point, Tangent, Parameter
curve_closest_point_6 = CurveClosestPoint(Point=evaluate_length_12.Point, Curve=curve_2)  # -> Point, Parameter, Distance
line_13 = Line(StartPoint=curve_closest_point_6.Point, EndPoint=evaluate_length_12.Point)

stream_filter_38 = StreamFilter(Gate=gate_not_25, Stream1=evaluate_length_12.Point)

line_sdl_8 = LineSDL(Start=stream_filter_38, Direction=line_13, Length=expr("ABS(X)", multiplication_22))

end_points_7 = EndPoints(Curve=line_sdl_8)  # -> Start, End
pull_point_19 = PullPoint(Point=end_points_7.Start, Geometry=surface, ClosestOnly=True)  # -> ClosestPoint, Distance
pull_point_20 = PullPoint(Point=end_points_7.End, Geometry=surface, ClosestOnly=True)  # -> ClosestPoint, Distance
line_14 = Line(StartPoint=pull_point_19.ClosestPoint, EndPoint=pull_point_20.ClosestPoint)
stream_filter_39 = StreamFilter(Gate=gate_not_4, Stream0=line_sdl_8, Stream1=line_14)

evaluate_length_13 = EvaluateLength(Curve=stream_filter_39, Length=1, Normalized=True)  # -> Point, Tangent, Parameter
custom_preview_14 = CustomPreview(Geometry=stream_filter_39, Material=create_material_23)
iiiiiii = ClusterOutput(stream_filter_39)  # IIIIIII

pull_point_21 = PullPoint(Point=evaluate_length_13.Point, Geometry=surface, ClosestOnly=True)  # -> ClosestPoint, Distance
stream_filter_40 = StreamFilter(Gate=gate_not_4, Stream0=evaluate_length_13.Point, Stream1=pull_point_21.ClosestPoint)

interpolate_7 = Interpolate(Vertices=stream_filter_40, Degree=1, Periodic=False, KnotStyle=2)  # -> Curve, Length, Domain
custom_preview_15 = CustomPreview(Geometry=interpolate_7.Curve, Material=create_material_22)

explode_7 = Explode(Curve=interpolate_7.Curve, Recursive=True)  # -> Segments, Vertices
evaluate_length_14 = EvaluateLength(Curve=explode_7.Segments, Length=0.5, Normalized=True)  # -> Point, Tangent, Parameter
curve_closest_point_7 = CurveClosestPoint(Point=evaluate_length_14.Point, Curve=curve_2)  # -> Point, Parameter, Distance
line_15 = Line(StartPoint=curve_closest_point_7.Point, EndPoint=evaluate_length_14.Point)

stream_filter_41 = StreamFilter(Gate=gate_not_23, Stream1=evaluate_length_14.Point)

line_sdl_9 = LineSDL(Start=stream_filter_41, Direction=line_15, Length=expr("ABS(X)", multiplication_20))

end_points_8 = EndPoints(Curve=line_sdl_9)  # -> Start, End
pull_point_22 = PullPoint(Point=end_points_8.Start, Geometry=surface, ClosestOnly=True)  # -> ClosestPoint, Distance
pull_point_23 = PullPoint(Point=end_points_8.End, Geometry=surface, ClosestOnly=True)  # -> ClosestPoint, Distance
line_16 = Line(StartPoint=pull_point_22.ClosestPoint, EndPoint=pull_point_23.ClosestPoint)
stream_filter_42 = StreamFilter(Gate=gate_not_4, Stream0=line_sdl_9, Stream1=line_16)

evaluate_length_15 = EvaluateLength(Curve=stream_filter_42, Length=1, Normalized=True)  # -> Point, Tangent, Parameter
custom_preview_16 = CustomPreview(Geometry=stream_filter_42, Material=create_material_21)
iiiiiiii = ClusterOutput(stream_filter_42)  # IIIIIIII

pull_point_24 = PullPoint(Point=evaluate_length_15.Point, Geometry=surface, ClosestOnly=True)  # -> ClosestPoint, Distance
stream_filter_43 = StreamFilter(Gate=gate_not_4, Stream0=evaluate_length_15.Point, Stream1=pull_point_24.ClosestPoint)

interpolate_8 = Interpolate(Vertices=stream_filter_43, Degree=1, Periodic=False, KnotStyle=2)  # -> Curve, Length, Domain
custom_preview_17 = CustomPreview(Geometry=interpolate_8.Curve, Material=create_material_20)

explode_8 = Explode(Curve=interpolate_8.Curve, Recursive=True)  # -> Segments, Vertices
evaluate_length_16 = EvaluateLength(Curve=explode_8.Segments, Length=0.5, Normalized=True)  # -> Point, Tangent, Parameter
curve_closest_point_8 = CurveClosestPoint(Point=evaluate_length_16.Point, Curve=curve_2)  # -> Point, Parameter, Distance
line_17 = Line(StartPoint=curve_closest_point_8.Point, EndPoint=evaluate_length_16.Point)

stream_filter_44 = StreamFilter(Gate=gate_not_21, Stream1=evaluate_length_16.Point)

line_sdl_10 = LineSDL(Start=stream_filter_44, Direction=line_17, Length=expr("ABS(X)", multiplication_18))

end_points_9 = EndPoints(Curve=line_sdl_10)  # -> Start, End
pull_point_25 = PullPoint(Point=end_points_9.Start, Geometry=surface, ClosestOnly=True)  # -> ClosestPoint, Distance
pull_point_26 = PullPoint(Point=end_points_9.End, Geometry=surface, ClosestOnly=True)  # -> ClosestPoint, Distance
line_18 = Line(StartPoint=pull_point_25.ClosestPoint, EndPoint=pull_point_26.ClosestPoint)
stream_filter_45 = StreamFilter(Gate=gate_not_4, Stream0=line_sdl_10, Stream1=line_18)

evaluate_length_17 = EvaluateLength(Curve=stream_filter_45, Length=1, Normalized=True)  # -> Point, Tangent, Parameter
custom_preview_18 = CustomPreview(Geometry=stream_filter_45, Material=create_material_19)
iiiiiiiii = ClusterOutput(stream_filter_45)  # IIIIIIIII

pull_point_27 = PullPoint(Point=evaluate_length_17.Point, Geometry=surface, ClosestOnly=True)  # -> ClosestPoint, Distance
stream_filter_46 = StreamFilter(Gate=gate_not_4, Stream0=evaluate_length_17.Point, Stream1=pull_point_27.ClosestPoint)

interpolate_9 = Interpolate(Vertices=stream_filter_46, Degree=1, Periodic=False, KnotStyle=2)  # -> Curve, Length, Domain
custom_preview_19 = CustomPreview(Geometry=interpolate_9.Curve, Material=create_material_18)

explode_9 = Explode(Curve=interpolate_9.Curve, Recursive=True)  # -> Segments, Vertices
evaluate_length_18 = EvaluateLength(Curve=explode_9.Segments, Length=0.5, Normalized=True)  # -> Point, Tangent, Parameter
curve_closest_point_9 = CurveClosestPoint(Point=evaluate_length_18.Point, Curve=curve_2)  # -> Point, Parameter, Distance
line_19 = Line(StartPoint=curve_closest_point_9.Point, EndPoint=evaluate_length_18.Point)

stream_filter_47 = StreamFilter(Gate=gate_not_19, Stream1=evaluate_length_18.Point)

line_sdl_11 = LineSDL(Start=stream_filter_47, Direction=line_19, Length=expr("ABS(X)", multiplication_16))

end_points_10 = EndPoints(Curve=line_sdl_11)  # -> Start, End
pull_point_28 = PullPoint(Point=end_points_10.Start, Geometry=surface, ClosestOnly=True)  # -> ClosestPoint, Distance
pull_point_29 = PullPoint(Point=end_points_10.End, Geometry=surface, ClosestOnly=True)  # -> ClosestPoint, Distance
line_20 = Line(StartPoint=pull_point_28.ClosestPoint, EndPoint=pull_point_29.ClosestPoint)
stream_filter_48 = StreamFilter(Gate=gate_not_4, Stream0=line_sdl_11, Stream1=line_20)

evaluate_length_19 = EvaluateLength(Curve=stream_filter_48, Length=1, Normalized=True)  # -> Point, Tangent, Parameter
custom_preview_20 = CustomPreview(Geometry=stream_filter_48, Material=create_material_17)
iiiiiiiiii = ClusterOutput(stream_filter_48)  # IIIIIIIIII

pull_point_30 = PullPoint(Point=evaluate_length_19.Point, Geometry=surface, ClosestOnly=True)  # -> ClosestPoint, Distance
stream_filter_49 = StreamFilter(Gate=gate_not_4, Stream0=evaluate_length_19.Point, Stream1=pull_point_30.ClosestPoint)

interpolate_10 = Interpolate(Vertices=stream_filter_49, Degree=1, Periodic=False, KnotStyle=2)  # -> Curve, Length, Domain
custom_preview_21 = CustomPreview(Geometry=interpolate_10.Curve, Material=create_material_16)

explode_10 = Explode(Curve=interpolate_10.Curve, Recursive=True)  # -> Segments, Vertices
evaluate_length_20 = EvaluateLength(Curve=explode_10.Segments, Length=0.5, Normalized=True)  # -> Point, Tangent, Parameter
curve_closest_point_10 = CurveClosestPoint(Point=evaluate_length_20.Point, Curve=curve_2)  # -> Point, Parameter, Distance
line_21 = Line(StartPoint=curve_closest_point_10.Point, EndPoint=evaluate_length_20.Point)

stream_filter_50 = StreamFilter(Gate=gate_not_17, Stream1=evaluate_length_20.Point)

line_sdl_12 = LineSDL(Start=stream_filter_50, Direction=line_21, Length=expr("ABS(X)", multiplication_14))

end_points_11 = EndPoints(Curve=line_sdl_12)  # -> Start, End
pull_point_31 = PullPoint(Point=end_points_11.Start, Geometry=surface, ClosestOnly=True)  # -> ClosestPoint, Distance
pull_point_32 = PullPoint(Point=end_points_11.End, Geometry=surface, ClosestOnly=True)  # -> ClosestPoint, Distance
line_22 = Line(StartPoint=pull_point_31.ClosestPoint, EndPoint=pull_point_32.ClosestPoint)
stream_filter_51 = StreamFilter(Gate=gate_not_4, Stream0=line_sdl_12, Stream1=line_22)

evaluate_length_21 = EvaluateLength(Curve=stream_filter_51, Length=1, Normalized=True)  # -> Point, Tangent, Parameter
custom_preview_22 = CustomPreview(Geometry=stream_filter_51, Material=create_material_15)
iiiiiiiiiii = ClusterOutput(stream_filter_51)  # IIIIIIIIIII

pull_point_33 = PullPoint(Point=evaluate_length_21.Point, Geometry=surface, ClosestOnly=True)  # -> ClosestPoint, Distance
stream_filter_52 = StreamFilter(Gate=gate_not_4, Stream0=evaluate_length_21.Point, Stream1=pull_point_33.ClosestPoint)

interpolate_11 = Interpolate(Vertices=stream_filter_52, Degree=1, Periodic=False, KnotStyle=2)  # -> Curve, Length, Domain
custom_preview_23 = CustomPreview(Geometry=interpolate_11.Curve, Material=create_material_14)

explode_11 = Explode(Curve=interpolate_11.Curve, Recursive=True)  # -> Segments, Vertices
evaluate_length_22 = EvaluateLength(Curve=explode_11.Segments, Length=0.5, Normalized=True)  # -> Point, Tangent, Parameter
curve_closest_point_11 = CurveClosestPoint(Point=evaluate_length_22.Point, Curve=curve_2)  # -> Point, Parameter, Distance
line_23 = Line(StartPoint=curve_closest_point_11.Point, EndPoint=evaluate_length_22.Point)

stream_filter_53 = StreamFilter(Gate=gate_not_15, Stream1=evaluate_length_22.Point)

line_sdl_13 = LineSDL(Start=stream_filter_53, Direction=line_23, Length=expr("ABS(X)", multiplication_12))

end_points_12 = EndPoints(Curve=line_sdl_13)  # -> Start, End
pull_point_34 = PullPoint(Point=end_points_12.Start, Geometry=surface, ClosestOnly=True)  # -> ClosestPoint, Distance
pull_point_35 = PullPoint(Point=end_points_12.End, Geometry=surface, ClosestOnly=True)  # -> ClosestPoint, Distance
line_24 = Line(StartPoint=pull_point_34.ClosestPoint, EndPoint=pull_point_35.ClosestPoint)
stream_filter_54 = StreamFilter(Gate=gate_not_4, Stream0=line_sdl_13, Stream1=line_24)

evaluate_length_23 = EvaluateLength(Curve=stream_filter_54, Length=1, Normalized=True)  # -> Point, Tangent, Parameter
custom_preview_24 = CustomPreview(Geometry=stream_filter_54, Material=create_material_13)
iiiiiiiiiiii = ClusterOutput(stream_filter_54)  # IIIIIIIIIIII

pull_point_36 = PullPoint(Point=evaluate_length_23.Point, Geometry=surface, ClosestOnly=True)  # -> ClosestPoint, Distance
stream_filter_55 = StreamFilter(Gate=gate_not_4, Stream0=evaluate_length_23.Point, Stream1=pull_point_36.ClosestPoint)

interpolate_12 = Interpolate(Vertices=stream_filter_55, Degree=1, Periodic=False, KnotStyle=2)  # -> Curve, Length, Domain
custom_preview_25 = CustomPreview(Geometry=interpolate_12.Curve, Material=create_material_12)

explode_12 = Explode(Curve=interpolate_12.Curve, Recursive=True)  # -> Segments, Vertices
evaluate_length_24 = EvaluateLength(Curve=explode_12.Segments, Length=0.5, Normalized=True)  # -> Point, Tangent, Parameter
curve_closest_point_12 = CurveClosestPoint(Point=evaluate_length_24.Point, Curve=curve_2)  # -> Point, Parameter, Distance
line_25 = Line(StartPoint=curve_closest_point_12.Point, EndPoint=evaluate_length_24.Point)

stream_filter_56 = StreamFilter(Gate=gate_not_13, Stream1=evaluate_length_24.Point)

line_sdl_14 = LineSDL(Start=stream_filter_56, Direction=line_25, Length=expr("ABS(X)", multiplication_10))

end_points_13 = EndPoints(Curve=line_sdl_14)  # -> Start, End
pull_point_37 = PullPoint(Point=end_points_13.Start, Geometry=surface, ClosestOnly=True)  # -> ClosestPoint, Distance
pull_point_38 = PullPoint(Point=end_points_13.End, Geometry=surface, ClosestOnly=True)  # -> ClosestPoint, Distance
line_26 = Line(StartPoint=pull_point_37.ClosestPoint, EndPoint=pull_point_38.ClosestPoint)
stream_filter_57 = StreamFilter(Gate=gate_not_4, Stream0=line_sdl_14, Stream1=line_26)

evaluate_length_25 = EvaluateLength(Curve=stream_filter_57, Length=1, Normalized=True)  # -> Point, Tangent, Parameter
custom_preview_26 = CustomPreview(Geometry=stream_filter_57, Material=create_material_11)
iiiiiiiiiiiii = ClusterOutput(stream_filter_57)  # IIIIIIIIIIIII

pull_point_39 = PullPoint(Point=evaluate_length_25.Point, Geometry=surface, ClosestOnly=True)  # -> ClosestPoint, Distance
stream_filter_58 = StreamFilter(Gate=gate_not_4, Stream0=evaluate_length_25.Point, Stream1=pull_point_39.ClosestPoint)

interpolate_13 = Interpolate(Vertices=stream_filter_58, Degree=1, Periodic=False, KnotStyle=2)  # -> Curve, Length, Domain
custom_preview_27 = CustomPreview(Geometry=interpolate_13.Curve, Material=create_material_10)

explode_13 = Explode(Curve=interpolate_13.Curve, Recursive=True)  # -> Segments, Vertices
evaluate_length_26 = EvaluateLength(Curve=explode_13.Segments, Length=0.5, Normalized=True)  # -> Point, Tangent, Parameter
curve_closest_point_13 = CurveClosestPoint(Point=evaluate_length_26.Point, Curve=curve_2)  # -> Point, Parameter, Distance
line_27 = Line(StartPoint=curve_closest_point_13.Point, EndPoint=evaluate_length_26.Point)

stream_filter_59 = StreamFilter(Gate=gate_not_11, Stream1=evaluate_length_26.Point)

line_sdl_15 = LineSDL(Start=stream_filter_59, Direction=line_27, Length=expr("ABS(X)", multiplication_8))

end_points_14 = EndPoints(Curve=line_sdl_15)  # -> Start, End
pull_point_40 = PullPoint(Point=end_points_14.Start, Geometry=surface, ClosestOnly=True)  # -> ClosestPoint, Distance
pull_point_41 = PullPoint(Point=end_points_14.End, Geometry=surface, ClosestOnly=True)  # -> ClosestPoint, Distance
line_28 = Line(StartPoint=pull_point_40.ClosestPoint, EndPoint=pull_point_41.ClosestPoint)
stream_filter_60 = StreamFilter(Gate=gate_not_4, Stream0=line_sdl_15, Stream1=line_28)

evaluate_length_27 = EvaluateLength(Curve=stream_filter_60, Length=1, Normalized=True)  # -> Point, Tangent, Parameter
custom_preview_28 = CustomPreview(Geometry=stream_filter_60, Material=create_material_9)
iiiiiiiiiiiiii = ClusterOutput(stream_filter_60)  # IIIIIIIIIIIIII

pull_point_42 = PullPoint(Point=evaluate_length_27.Point, Geometry=surface, ClosestOnly=True)  # -> ClosestPoint, Distance
stream_filter_61 = StreamFilter(Gate=gate_not_4, Stream0=evaluate_length_27.Point, Stream1=pull_point_42.ClosestPoint)

interpolate_14 = Interpolate(Vertices=stream_filter_61, Degree=1, Periodic=False, KnotStyle=2)  # -> Curve, Length, Domain
custom_preview_29 = CustomPreview(Geometry=interpolate_14.Curve, Material=create_material_8)

explode_14 = Explode(Curve=interpolate_14.Curve, Recursive=True)  # -> Segments, Vertices
evaluate_length_28 = EvaluateLength(Curve=explode_14.Segments, Length=0.5, Normalized=True)  # -> Point, Tangent, Parameter
curve_closest_point_14 = CurveClosestPoint(Point=evaluate_length_28.Point, Curve=curve_2)  # -> Point, Parameter, Distance
line_29 = Line(StartPoint=curve_closest_point_14.Point, EndPoint=evaluate_length_28.Point)

stream_filter_62 = StreamFilter(Gate=gate_not_9, Stream1=evaluate_length_28.Point)

line_sdl_16 = LineSDL(Start=stream_filter_62, Direction=line_29, Length=expr("ABS(X)", multiplication_6))

end_points_15 = EndPoints(Curve=line_sdl_16)  # -> Start, End
pull_point_43 = PullPoint(Point=end_points_15.Start, Geometry=surface, ClosestOnly=True)  # -> ClosestPoint, Distance
pull_point_44 = PullPoint(Point=end_points_15.End, Geometry=surface, ClosestOnly=True)  # -> ClosestPoint, Distance
line_30 = Line(StartPoint=pull_point_43.ClosestPoint, EndPoint=pull_point_44.ClosestPoint)
stream_filter_63 = StreamFilter(Gate=gate_not_4, Stream0=line_sdl_16, Stream1=line_30)

evaluate_length_29 = EvaluateLength(Curve=stream_filter_63, Length=1, Normalized=True)  # -> Point, Tangent, Parameter
custom_preview_30 = CustomPreview(Geometry=stream_filter_63, Material=create_material_7)
iiiiiiiiiiiiiii = ClusterOutput(stream_filter_63)  # IIIIIIIIIIIIIII

pull_point_45 = PullPoint(Point=evaluate_length_29.Point, Geometry=surface, ClosestOnly=True)  # -> ClosestPoint, Distance
stream_filter_64 = StreamFilter(Gate=gate_not_4, Stream0=evaluate_length_29.Point, Stream1=pull_point_45.ClosestPoint)

interpolate_15 = Interpolate(Vertices=stream_filter_64, Degree=1, Periodic=False, KnotStyle=2)  # -> Curve, Length, Domain
custom_preview_31 = CustomPreview(Geometry=interpolate_15.Curve, Material=create_material_6)

explode_15 = Explode(Curve=interpolate_15.Curve, Recursive=True)  # -> Segments, Vertices
evaluate_length_30 = EvaluateLength(Curve=explode_15.Segments, Length=0.5, Normalized=True)  # -> Point, Tangent, Parameter
curve_closest_point_15 = CurveClosestPoint(Point=evaluate_length_30.Point, Curve=curve_2)  # -> Point, Parameter, Distance
line_31 = Line(StartPoint=curve_closest_point_15.Point, EndPoint=evaluate_length_30.Point)

stream_filter_65 = StreamFilter(Gate=gate_not_7, Stream1=evaluate_length_30.Point)

line_sdl_17 = LineSDL(Start=stream_filter_65, Direction=line_31, Length=expr("ABS(X)", multiplication_4))

end_points_16 = EndPoints(Curve=line_sdl_17)  # -> Start, End
pull_point_46 = PullPoint(Point=end_points_16.Start, Geometry=surface, ClosestOnly=True)  # -> ClosestPoint, Distance
pull_point_47 = PullPoint(Point=end_points_16.End, Geometry=surface, ClosestOnly=True)  # -> ClosestPoint, Distance
line_32 = Line(StartPoint=pull_point_46.ClosestPoint, EndPoint=pull_point_47.ClosestPoint)
stream_filter_66 = StreamFilter(Gate=gate_not_4, Stream0=line_sdl_17, Stream1=line_32)

merge = Merge(
    Data1=stream_filter_21,
    Data2=stream_filter_24,
    Data3=stream_filter_27,
    Data4=stream_filter_30,
    Data5=stream_filter_33,
    Data6=stream_filter_36,
    Data7=stream_filter_39,
    Data8=stream_filter_42,
    Data9=stream_filter_45,
    Data10=stream_filter_48,
    Data11=stream_filter_51,
    Data12=stream_filter_54,
    Data13=stream_filter_57,
    Data14=stream_filter_60,
    Data15=stream_filter_63,
    Data16=stream_filter_66)  # -> graft(Result); disabled
x_27 = ClusterInput()  # ⊚
stream_filter_67 = StreamFilter(
    Gate=x_27,
    Stream1=stream_filter_21,
    Stream2=stream_filter_24,
    Stream3=stream_filter_27,
    Stream4=stream_filter_30,
    Stream5=stream_filter_33,
    Stream6=stream_filter_36,
    Stream7=stream_filter_39,
    Stream8=stream_filter_42,
    Stream9=stream_filter_45,
    Stream10=stream_filter_48,
    Stream11=stream_filter_51,
    Stream12=stream_filter_54,
    Stream13=stream_filter_57,
    Stream14=stream_filter_60,
    Stream15=stream_filter_63,
    Stream16=stream_filter_66)
integer = Integer(x_27)

merge_2 = Merge(
    Data1=one_over_x,
    Data2=shift_list,
    Data3=shift_list_2,
    Data4=shift_list_3,
    Data5=shift_list_4,
    Data6=shift_list_5,
    Data7=shift_list_6,
    Data8=shift_list_7,
    Data9=shift_list_8,
    Data10=shift_list_9,
    Data11=shift_list_10,
    Data12=shift_list_11,
    Data13=shift_list_12,
    Data14=shift_list_13,
    Data15=shift_list_14,
    Data16=shift_list_15)  # -> graft(Result); disabled
stream_filter_68 = StreamFilter(
    Gate=x_27,
    Stream1=one_over_x,
    Stream2=shift_list,
    Stream3=shift_list_2,
    Stream4=shift_list_3,
    Stream5=shift_list_4,
    Stream6=shift_list_5,
    Stream7=shift_list_6,
    Stream8=shift_list_7,
    Stream9=shift_list_8,
    Stream10=shift_list_9,
    Stream11=shift_list_10,
    Stream12=shift_list_11,
    Stream13=shift_list_12,
    Stream14=shift_list_13,
    Stream15=shift_list_14,
    Stream16=shift_list_15)

shortest_list = ShortestList(ListListA=flatten(merge_2), ListListB=flatten(merge), TrimMode=2)  # -> ListListA, ListListB; disabled

length_2 = Length(Curve=stream_filter_67)
multiplication_33 = Multiplication(A=x_2, B=length_2)
x_28 = ClusterOutput(x_2)  # ⇔

one_over_x_2 = OneOverX(Value=stream_filter_68)
format_18 = Format(Format=" {0:R} ", Culture=127, Data0=one_over_x_2)
format_19 = Format(Format="{0:R}", Culture=127, Data0=stream_filter_68)
stream_filter_69 = StreamFilter(Gate=boolean, Stream0=format_19, Stream1=format_18)
stream_filter_70 = StreamFilter(Gate=boolean_2, Stream1=stream_filter_67)
custom_preview_lineweights = CustomPreviewLineweights(
    Geometry=stream_filter_67,
    Shader={diffuse=RGB(0, 244, 124), emission=RGB(0, 73, 37), shine=0.5, specular=RGB(255, 255, 255), transparency=0},
    Thickness=2,
    Absolute=False)
line_dimension = LineDimension(Line=graft(stream_filter_70), Text=graft(stream_filter_69), Size=graft(multiplication_33))
x_29 = ClusterOutput(stream_filter_69)  # *
x_30 = ClusterOutput(integer)  # ⊚

evaluate_length_31 = EvaluateLength(Curve=stream_filter_66, Length=1, Normalized=True)  # -> Point, Tangent, Parameter
custom_preview_32 = CustomPreview(Geometry=stream_filter_66, Material=create_material_5)
iiiiiiiiiiiiiiii = ClusterOutput(stream_filter_66)  # IIIIIIIIIIIIIIII

pull_point_48 = PullPoint(Point=evaluate_length_31.Point, Geometry=surface, ClosestOnly=True)  # -> ClosestPoint, Distance
stream_filter_71 = StreamFilter(Gate=gate_not_4, Stream0=evaluate_length_31.Point, Stream1=pull_point_48.ClosestPoint)

interpolate_16 = Interpolate(Vertices=stream_filter_71, Degree=1, Periodic=False, KnotStyle=2)  # -> Curve, Length, Domain
custom_preview_33 = CustomPreview(Geometry=interpolate_16.Curve, Material=create_material_4)
