# Grasshopper definition XHG...⠀⠀⠀⠀ⵙ⠀ᗩ⠀ⵙ⠀✤⠀ⵙ⠀ᗩ⠀ⵙ⠀✤⠀ⵙ⠀ᑐᑕ⠀ⵙ⠀ꖴ⠀ⵙ⠀옷⠀ⵙ⠀⊚⠀ⵙ⠀ᗩ⠀ⵙ⠀Н⠀ⵙ⠀І⠀ⵙ⠀ᙁ⠀ⵙ⠀ᗝ⠀ⵙ⠀⊚⠀ⵙ⠀ꖴ⠀ⵙ⠀ᙏ⠀ⵙ⠀ᗱᗴ⠀ⵙ⠀ߦ⠀ⵙ⠀Ẏ⠀ⵙ⠀⠀⠀⠀◯⠀⠀⠀⠀ⵙ⠀⠀⠀⠀◯⠀⠀⠀⠀ⵙ⠀Ẏ⠀ⵙ⠀ߦ⠀ⵙ⠀ᗱᗴ⠀ⵙ⠀ᙏ⠀ⵙ⠀ꖴ⠀ⵙ⠀⊚⠀ⵙ⠀ᗝ⠀ⵙ⠀ᙁ⠀ⵙ⠀І⠀ⵙ⠀Н⠀ⵙ⠀ᗩ⠀ⵙ⠀⊚⠀ⵙ⠀옷⠀ⵙ⠀ꖴ⠀ⵙ⠀ᑐᑕ⠀ⵙ⠀✤⠀ⵙ⠀ᗩ⠀ⵙ⠀✤⠀ⵙ⠀ᗩ⠀ⵙ⠀⠀⠀⠀...GHX (Grasshopper 1.0.7)
# plug-ins: Firefly.X, CurvePlus

panel = Panel("84.406022589954030768899117092091000289089388918088900852079")
series = Series(Start="0", Step="1", Count="14")
power = Power(A="3", B=series)
division = Division(A=panel, B=power)
multiplication = Multiplication(A=division, B="299792458")
graft_tree = GraftTree(Tree=multiplication, IncludeEmptyLists=True, IncludeNullItems=True)
graft_tree_2 = GraftTree(Tree=division, IncludeEmptyLists=True, IncludeNullItems=True)
division_2 = Division(A=power, B=panel)
graft_tree_3 = GraftTree(Tree=division_2, IncludeEmptyLists=True, IncludeNullItems=True)
power_2 = Power(A="3", B="6")
division_3 = Division(A=panel, B=power_2)
one_over_x = OneOverX(Value=power_2)
construct_point = ConstructPoint(XCoordinate=0, YCoordinate=graft_tree_2, ZCoordinate=0)
panel_2 = Panel([graft_tree_2, graft_tree_3, graft_tree])
numbers_to_points = NumbersToPoints(Numbers=panel_2, Mask=4)
line = Line(StartPoint=Point(0, 0, 0), EndPoint=construct_point)
spiral_rail = SpiralRail(Curve=line, Angle=0, Turns=1, BaseRadius=construct_point, PeakRadius=construct_point, SamplePoint=256)
xz_plane = XZPlane(Origin=Point(0, 0, 0))
rotate = Rotate(Geometry=spiral_rail, Angle=1.570796327, Plane=xz_plane)  # -> Geometry, Transform
text_tag = TextTag(Location=construct_point, Text=numbers_to_points, Colour=RGB(212, 212, 212))
tone_generator = ToneGenerator(AudioFrequency=division_2, Volume=one_over_x, Duration=division_3, Repeat=Toggle(True))
