# Grasshopper definition XHG.⠀ⵙ⠀ᗝ⠀ⵙ⠀ꖴ⠀ⵙ⠀Ⓞ⠀ⵙ⠀ᙏ⠀ⵙ⠀ᕤᕦ⠀ⵙ⠀ꖴ⠀ⵙ⠀ᔓᔕ⠀ⵙ⠀◯⠀ⵙ⠀ИN⠀ⵙ⠀Ⓞ⠀ⵙ⠀ꖴ⠀ⵙ⠀✤⠀ⵙ⠀ꖴ⠀ⵙ⠀ᔓᔕ⠀ⵙ⠀ИN⠀ⵙ⠀ᗩ⠀ⵙ⠀ᴥ⠀ⵙ⠀✤⠀ⵙ⠀◯⠀ⵙ⠀ᗱᗴ⠀ⵙ⠀ᕤᕦ⠀ⵙ⠀ᗝ⠀ⵙ⠀ᗱᗴ⠀ⵙ⠀◯⠀ⵙ⠀ᙁ⠀ⵙ⠀ᑎ⠀ⵙ⠀ꗳ⠀ⵙ⠀◯⠀ⵙ⠀◯⠀ⵙ⠀ꗳ⠀ⵙ⠀ᑎ⠀ⵙ⠀ᙁ⠀ⵙ⠀◯⠀ⵙ⠀ᗱᗴ⠀ⵙ⠀ᗝ⠀ⵙ⠀ᕤᕦ⠀ⵙ⠀ᗱᗴ⠀ⵙ⠀◯⠀ⵙ⠀✤⠀ⵙ⠀ᴥ⠀ⵙ⠀ᗩ⠀ⵙ⠀ИN⠀ⵙ⠀ᔓᔕ⠀ⵙ⠀ꖴ⠀ⵙ⠀✤⠀ⵙ⠀ꖴ⠀ⵙ⠀Ⓞ⠀ⵙ⠀ИN⠀ⵙ⠀◯⠀ⵙ⠀ᔓᔕ⠀ⵙ⠀ꖴ⠀ⵙ⠀ᕤᕦ⠀ⵙ⠀ᙏ⠀ⵙ⠀Ⓞ⠀ⵙ⠀ꖴ⠀ⵙ⠀ᗝ⠀ⵙ⠀.GHX (Grasshopper 1.0.7)
# plug-ins: Pufferfish, Heteroptera

digit_scroller = DigitScroller(Scroller_Digits=12, Scroller_Prefix=" ", Scroller_Radix=1, Scroller_Value=0.5)
line_sdl = LineSDL(Start=Point(0, 0, 0), Direction=Vector(-0.5, 0, 0), Length=1)
line_sdl_2 = LineSDL(Start=Point(1, 1, 0), Direction=Vector(1, 0, 0), Length=1)
flip_curve = FlipCurve(Curve=line_sdl)  # -> Curve, Flag
blend_curve = BlendCurve(CurveA=flip_curve.Curve, CurveB=line_sdl_2, BulgeA=digit_scroller, BulgeB=digit_scroller, Continuity=2)
flip_curve_2 = FlipCurve(Curve=line_sdl_2)  # -> Curve, Flag

point = Point(Point(0.5, 0.5, 0))  # disabled
xy_plane = XYPlane(Origin=point)  # disabled
point_2 = Point(Point(0, 0, 0))  # disabled
point_3 = Point(Point(0.25, 0, 0))  # disabled
point_4 = Point(Point(0.3947752686, 0.1978476179, 0))  # disabled
merge = Merge(Data1=point_2, Data2=point_3, Data3=point_4)  # disabled
rotate = Rotate(Geometry=merge, Angle=3.141592654, Plane=point)  # -> reverse(Geometry), Transform; disabled
mirror = Mirror(Geometry=rotate.Geometry, Plane=xy_plane)  # -> Geometry, Transform; disabled
merge_2 = Merge(Data1=merge, Data2=point, Data3=mirror.Geometry)  # disabled
nurbs_curve = NurbsCurve(Vertices=merge_2, Degree=11, Periodic=False)  # -> Curve, Length, Domain; disabled
interpolate = Interpolate(Vertices=merge_2, Degree=3, Periodic=False, KnotStyle=1)  # -> Curve, Length, Domain; disabled
point_5 = Point(Point(0.2006577215, 0, 0))  # disabled
point_6 = Point(Point(0.2830260225, 0.08609833668, 0))  # disabled
point_7 = Point(Point(0.3323482284, 0.16322326, 0))  # disabled

curve = Curve(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)

curve_2 = Curve(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)  # disabled

digit_scroller_2 = DigitScroller(Scroller_Digits=12, Scroller_Prefix="Digit Scroller", Scroller_Radix=11, Scroller_Value=65536)  # disabled
construct_point = ConstructPoint(XCoordinate=0.5, YCoordinate=0.5, ZCoordinate=0)  # -> flatten(Point); disabled
line_sdl_3 = LineSDL(Start=Point(0, 0, 0), Direction=Vector(1, 0, 0), Length=expr("X/2", 1))  # disabled
button = Button()  # disabled
file_path = FilePath("C:\IICSA.O____48361_EDIWID_1_TNEMERCNI____TNEIDARG_PUKOOL_ROLOC_DIOMGIS_ERUTAWRUC_RAENIL_NOITISNART_EGDE_LUF_EKUN____O____NUKE_FUL_EDGE_TRANSITION_LINEAR_CURWATURE_SIGMOID_COLOR_LOOKUP_GRADIENT____INCREMENT_1_DIWIDE_16384____O.ASCII")  # disabled
number = Number(digit_scroller_2)  # disabled

button_2 = Button()  # disabled
file_path_2 = FilePath("C:\VSC.O____STNEMGES_48361____DIOMGIS_ERUTAWRUC_RAENIL_NOITISNART_EGDE_LUF____O____FUL_EDGE_TRANSITION_LINEAR_CURWATURE_SIGMOID____16384_SEGMENTS____O.CSV")  # disabled

number_slider = Slider(0, range=0..1)  # disabled
button_3 = Button()  # disabled
file_path_3 = FilePath("C:\VSC.O____EPAHS_LANGIS____STNEMGES_48361____DIOMGIS_ERUTAWRUC_RAENIL_NOITISNART_EGDE_LUF____O____FUL_EDGE_TRANSITION_LINEAR_CURWATURE_SIGMOID____16384_SEGMENTS____SIGNAL_SHAPE____O.CSV")  # disabled

panel = Panel("0.0000053644183496292")  # disabled
panel_2 = Panel("""0    256    0.0013733120705119695
0    4096    0.0000053644183496292""")  # disabled

digit_scroller_3 = DigitScroller(Scroller_Digits=12, Scroller_Prefix="Digit Scroller", Scroller_Radix=1, Scroller_Value=3.3527e-07)  # disabled
number_slider_2 = Slider(4096, range=0..65536)  # disabled
radians = Radians(Degrees=panel)  # disabled

number_2 = Number(number_slider_2)  # disabled

series = Series(Start=0, Step=radians, Count=number_2)  # disabled
one_over_x = OneOverX(Value=number_2)  # disabled
duplicate_data = DuplicateData(Data=one_over_x, Number=number_2, Order=True)  # disabled
turtle = DotNETVBScriptLEGACY(Forward=duplicate_data, Left=series)  # -> Output, Points; inputs Forward: list, Left: list; disabled
# ---------- turtle: VB ----------
    Dim i As Integer
    Dim dir As New On3dVector(1, 0, 0)    
    Dim pos As New On3dVector(0, 0, 0) 
    Dim axis As New On3dVector(0, 0, 1)
    Dim pnts As New List(Of On3dVector)

    pnts.Add(pos)
    
    For i = 0 To Forward.Count() - 1
      Dim P As New On3dVector
      dir.Rotate(Left(i), axis)      
      P = dir * Forward(i) + pnts(i)
      pnts.Add(P)
    Next
    
    Points = pnts
# ---------- end turtle ----------
point_8 = Point(turtle.Points)  # disabled

interpolate_t = InterpolateT(Vertices=point_8, TangentStart=Vector(0.0625, 0, 0), TangentEnd=Vector(0, 0, 0), KnotStyle=2)  # -> Curve, Length, Domain; disabled
evaluate_length = EvaluateLength(Curve=interpolate_t.Curve, Length=1, Normalized=True)  # -> Point, Tangent, Parameter; disabled
line_sdl_4 = LineSDL(Start=evaluate_length.Point, Direction=evaluate_length.Tangent, Length=1)  # disabled
mirror_2 = Mirror(Geometry=interpolate_t.Curve, Plane=line_sdl_4)  # -> Geometry, Transform; disabled
join_curves = JoinCurves(Curves=[interpolate_t.Curve, mirror_2.Geometry], Preserve=False)  # disabled
evaluate_length_2 = EvaluateLength(Curve=join_curves, Length=1, Normalized=True)  # -> Point, Tangent, Parameter; disabled
rotate_2 = Rotate(Geometry=join_curves, Angle=3.141592654, Plane=evaluate_length_2.Point)  # -> Geometry, Transform; disabled
join_curves_2 = JoinCurves(Curves=[join_curves, rotate_2.Geometry], Preserve=False)  # disabled
curve_3 = Curve(join_curves_2)  # disabled

expression = Expression(O=turtle.Points, Expression="FORMAT(\"{0:R}\",O)")  # disabled
panel_3 = Panel(expression)  # disabled
expression_2 = Expression(O=series, Expression="FORMAT(\"{0:R}\",O)")  # disabled
panel_4 = Panel(expression_2)  # disabled
evaluate_length_3 = EvaluateLength(Curve=join_curves_2, Length=1, Normalized=True)  # -> Point, Tangent, Parameter; disabled
deconstruct = Deconstruct(Point=evaluate_length_3.Point)  # -> XComponent, YComponent, ZComponent; disabled
expression_3 = Expression(O=deconstruct.YComponent, Expression="FORMAT(\"{0:R}\",O)")  # disabled
expression_4 = Expression(O=deconstruct.XComponent, Expression="FORMAT(\"{0:R}\",O)")  # disabled
expression_5 = Expression(O=deconstruct.ZComponent, Expression="FORMAT(\"{0:R}\",O)")  # disabled
panel_5 = Panel(expression_3)  # disabled
panel_6 = Panel(expression_4)  # disabled
panel_7 = Panel(expression_5)  # disabled
addition = Addition(A=panel_5, B=panel_6)  # disabled
expression_6 = Expression(O=addition, Expression="FORMAT(\"{0:R}\",O)")  # disabled
panel_8 = Panel(expression_6)  # disabled
division = Division(A=panel_8, B=2)  # disabled
expression_7 = Expression(O=division, Expression="FORMAT(\"{0:R}\",O)")  # disabled
panel_9 = Panel(expression_7)  # disabled
scale = Scale(Geometry=curve_3, Center=Point(0, 0, 0), Factor=expr("1/X", panel_9))  # -> Geometry, Transform; disabled
evaluate_length_4 = EvaluateLength(Curve=scale.Geometry, Length=1, Normalized=True)  # -> Point, Tangent, Parameter; disabled
deconstruct_2 = Deconstruct(Point=evaluate_length_4.Point)  # -> XComponent, YComponent, ZComponent; disabled
expression_8 = Expression(O=deconstruct_2.YComponent, Expression="FORMAT(\"{0:R}\",O)")  # disabled
expression_9 = Expression(O=deconstruct_2.XComponent, Expression="FORMAT(\"{0:R}\",O)")  # disabled
expression_10 = Expression(O=deconstruct_2.ZComponent, Expression="FORMAT(\"{0:R}\",O)")  # disabled
panel_10 = Panel(expression_8)  # disabled
panel_11 = Panel(expression_9)  # disabled
panel_12 = Panel(expression_10)  # disabled
division_2 = Division(A=panel_6, B=panel_5)  # disabled
expression_11 = Expression(O=division_2, Expression="FORMAT(\"{0:R}\",O)")  # disabled
panel_13 = Panel(expression_11)  # disabled
curve_4 = Curve(scale.Geometry)  # disabled

number_3 = Number(expr("X*4", number_2))  # disabled
divide_curve = DivideCurve(Curve=line_sdl_3, Count=expr("X/2", number_3), Kinks=False)  # -> Points, Tangents, Parameters; disabled
line_sdl_5 = LineSDL(Start=divide_curve.Points, Direction=Vector(0, 1, 0), Length=1)  # disabled
scale_2 = Scale(Geometry=line_sdl_5, Center=Point(0, 0, 0), Factor=number)  # -> Geometry, Transform; disabled
curve_5 = Curve(curve_4)  # disabled
scale_3 = Scale(Geometry=curve_5, Center=Point(0, 0, 0), Factor=number)  # -> Geometry, Transform; disabled
curve_curve = CurveCurve(CurveA=scale_3.Geometry, CurveB=scale_2.Geometry)  # -> flatten(Points), ParamsA, ParamsB; disabled
scale_4 = Scale(Geometry=curve_curve.Points, Center=Point(0, 0, 0), Factor=expr("1/X", number))  # -> Geometry, Transform; disabled
deconstruct_3 = Deconstruct(Point=scale_4.Geometry)  # -> expr("ABS(X)", graft(XComponent)), expr("ABS(X)", graft(YComponent)), expr("ABS(X)", graft(ZComponent)); disabled
construct_point_2 = ConstructPoint(XCoordinate=deconstruct_3.XComponent, YCoordinate=deconstruct_3.YComponent, ZCoordinate=deconstruct_3.ZComponent)  # disabled
list_length = ListLength(List=scale_4.Geometry)  # disabled
panel_15 = Panel(list_length)  # disabled
construct_domain = ConstructDomain(DomainStart=0, DomainEnd=expr("X-2", panel_15))  # disabled
range = Range(Domain=construct_domain, Steps=expr("X-2", panel_15))  # disabled
list_item = ListItem(List=flatten(construct_point_2), Index=range, Wrap=False)  # -> flatten(Item); disabled
rotate_3 = Rotate(Geometry=list_item, Angle=3.141592654, Plane=construct_point)  # -> reverse(flatten(Geometry)), Transform; disabled
merge_3 = Merge(Data1=list_item, Data2=construct_point, Data3=rotate_3.Geometry)  # disabled
deconstruct_4 = Deconstruct(Point=merge_3)  # -> graft(XComponent), graft(YComponent), ZComponent; disabled
expression_12 = Expression(O=deconstruct_4.XComponent, Expression="FORMAT(\"{0:0.00000000000000}\",O)")  # disabled
expression_13 = Expression(O=deconstruct_4.XComponent, Expression="FORMAT(\"{0:R}\",O)")  # disabled
data = Data(expression_13)  # disabled
panel_16 = Panel(data)  # disabled
expression_14 = Expression(O=deconstruct_4.YComponent, Expression="FORMAT(\"{0:0.00000000000000}\",O)")  # disabled
expression_15 = Expression(O=deconstruct_4.YComponent, Expression="FORMAT(\"{0:R}\",O)")  # disabled
data_2 = Data(expression_15)  # disabled
panel_17 = Panel(data_2)  # disabled
txtwriter = VBScript(filePath=file_path, data=flatten(panel_17), activate=button)  # -> out, A; inputs data: list; disabled
# ---------- txtwriter: VB ----------
    If activate Then

      Dim i As Integer
      Dim aryText(4) As String

      aryText(0) = "Mary WriteLine"
      aryText(1) = "Had"
      aryText(2) = "Another"
      aryText(3) = "Little"
      aryText(4) = "One"

      ' the data is appended to the file. If file doesnt exist, a new file is created
      Dim objWriter As New System.IO.StreamWriter(filePath, append)

      For i = 0 To data.Count - 1
        objWriter.WriteLine(data(i))
      Next

      objWriter.Close()

    End If

    If clearFile Then
      Dim objWriter As New System.IO.StreamWriter(filePath, False)
      objWriter.Close()
    End If
# ---------- end txtwriter ----------

number_4 = Number(expr("X*4", number_2))  # disabled
curve_6 = Curve(curve_4)  # disabled
divide_curve_2 = DivideCurve(Curve=curve_6, Count=number_4, Kinks=False)  # -> Points, Tangents, Parameters; disabled
deconstruct_5 = Deconstruct(Point=divide_curve_2.Points)  # -> graft(XComponent), graft(YComponent), ZComponent; disabled
expression_16 = Expression(Y=deconstruct_5.YComponent, Expression="FORMAT(\"{0:R}\",ROUND(Y, 15))")  # -> simplify(Result); disabled
expression_17 = Expression(X=deconstruct_5.XComponent, Expression="FORMAT(\"{0:R}\",ROUND(X, 15))")  # -> simplify(Result); disabled
expression_18 = Expression(X=deconstruct_5.XComponent, Expression="FORMAT(\"{0:R}\",X)")  # -> simplify(Result); disabled
panel_18 = Panel(expression_18)  # disabled
expression_19 = Expression(Y=deconstruct_5.YComponent, Expression="FORMAT(\"{0:R}\",Y)")  # -> simplify(Result); disabled
list_length_2 = ListLength(List=divide_curve_2.Points)  # disabled
duplicate_data_2 = DuplicateData(Data=";", Number=list_length_2, Order=True)  # -> simplify(graft(Data)); disabled
panel_19 = Panel(duplicate_data_2)  # disabled
panel_20 = Panel(expression_19)  # disabled
concatenate = Concatenate(FragmentA=panel_18, FragmentB=panel_19, FragmentA_2=panel_20)  # -> flatten(Result); disabled
panel_21 = Panel(concatenate)  # disabled
txtwriter_2 = VBScript(filePath=file_path_2, data=flatten(panel_21), activate=button_2)  # -> out, A; inputs data: list; disabled; same code as txtwriter

number_5 = Number(expr("X*4", number_2))  # disabled
curve_7 = Curve(curve_4)  # disabled
evaluate_length_5 = EvaluateLength(Curve=curve_7, Length=flatten(1), Normalized=True)  # -> Point, Tangent, Parameter; disabled
yz_plane = YZPlane(Origin=evaluate_length_5.Point)  # disabled
mirror_3 = Mirror(Geometry=curve_7, Plane=yz_plane)  # -> Geometry, Transform; disabled
join_curves_3 = JoinCurves(Curves=[curve_7, mirror_3.Geometry], Preserve=False)  # disabled
linear_array = LinearArray(Geometry=join_curves_3, Direction=Vector(2, 0, 0), Count=2)  # -> Geometry, Transform; disabled
join_curves_4 = JoinCurves(Curves=linear_array.Geometry, Preserve=False)  # disabled
flip_curve_3 = FlipCurve(Curve=join_curves_4)  # -> Curve, Flag; disabled
stream_filter = StreamFilter(Gate=number_slider, Stream0=join_curves_4, Stream1=flip_curve_3.Curve)  # disabled
curve_domain = CurveDomain(Curve=stream_filter)  # -> Curve, Domain; disabled
deconstruct_domain = DeconstructDomain(Domain=curve_domain.Domain)  # -> Start, End; disabled
construct_domain_2 = ConstructDomain(DomainStart=expr("X/8", deconstruct_domain.End), DomainEnd=expr("X*5/8", deconstruct_domain.End))  # disabled
sub_curve = SubCurve(BaseCurve=curve_domain.Curve, Domain=construct_domain_2)  # disabled
move = Move(Geometry=sub_curve, Motion=Vector(-0.5, -0.5, 0))  # -> Geometry, Transform; disabled
scale_5 = Scale(Geometry=move.Geometry, Center=Point(0, 0, 0), Factor=0.5)  # -> Geometry, Transform; disabled
divide_curve_3 = DivideCurve(Curve=scale_5.Geometry, Count=number_5, Kinks=False)  # -> Points, Tangents, Parameters; disabled
deconstruct_6 = Deconstruct(Point=divide_curve_3.Points)  # -> simplify(graft(XComponent)), simplify(graft(YComponent)), ZComponent; disabled
expression_20 = Expression(X=deconstruct_6.XComponent, Expression="FORMAT(\"{0:R}\",X)")  # disabled
panel_22 = Panel(expression_20)  # disabled
expression_21 = Expression(Y=deconstruct_6.YComponent, Expression="FORMAT(\"{0:R}\",Y)")  # disabled
list_length_3 = ListLength(List=divide_curve_3.Points)  # disabled
duplicate_data_3 = DuplicateData(Data=";", Number=list_length_3, Order=True)  # -> simplify(graft(Data)); disabled
panel_23 = Panel(duplicate_data_3)  # disabled
panel_24 = Panel(expression_21)  # disabled
concatenate_2 = Concatenate(FragmentA=panel_22, FragmentB=panel_23, FragmentA_2=panel_24)  # -> flatten(Result); disabled
panel_25 = Panel(concatenate_2)  # disabled
txtwriter_3 = VBScript(filePath=file_path_3, data=flatten(panel_25), activate=button_3)  # -> out, A; inputs data: list; disabled; same code as txtwriter

line_sdl_6 = LineSDL(Start=Point(0, 0, 0), Direction=Vector(1, 0, 0), Length=1)

curve_8 = Curve(graft(nurbs_curve.Curve))
number_6 = Number(1024)
divide_curve_4 = DivideCurve(Curve=curve_8, Count=number_6, Kinks=False)  # -> Points, Tangents, Parameters
curvature = Curvature(Curve=curve_8, Parameter=divide_curve_4.Parameters)  # -> Point, Curvature, Curvature_2
deconstruct_arc = DeconstructArc(Arc=curvature.Curvature_2)  # -> BasePlane, Radius, Angle
expression_22 = Expression(O=deconstruct_arc.Radius, Expression="FORMAT(\"{0:R}\",O)")
panel_26 = Panel(expression_22)
one_over_x_2 = OneOverX(Value=deconstruct_arc.Radius)

expression_23 = Expression(O=one_over_x_2, Expression="FORMAT(\"{0:R}\",O)")
panel_27 = Panel(expression_23)

quick_graph = QuickGraph(one_over_x_2, SortOrder=0)
divide_curve_5 = DivideCurve(Curve=line_sdl_6, Count=number_6, Kinks=False)  # -> Points, Tangents, Parameters
multiplication = Multiplication(A=one_over_x_2, B=Slider(13.114764, range=0..256))
line_sdl_7 = LineSDL(Start=divide_curve_5.Points, Direction=Vector(0, 1, 0), Length=multiplication)

curve_9 = Curve(line_sdl_7)

panel_28 = Panel("0.0000053644183496292")  # disabled

digit_scroller_4 = DigitScroller(Scroller_Digits=12, Scroller_Prefix="Digit Scroller", Scroller_Radix=1, Scroller_Value=3.3527e-07)  # disabled
number_slider_3 = Slider(4096, range=0..65536)  # disabled
radians_2 = Radians(Degrees=panel_28)  # disabled

number_7 = Number(number_slider_3)  # disabled

series_2 = Series(Start=0, Step=radians_2, Count=number_7)  # disabled
one_over_x_3 = OneOverX(Value=number_7)  # disabled
duplicate_data_4 = DuplicateData(Data=one_over_x_3, Number=number_7, Order=True)  # disabled
turtle_2 = DotNETVBScriptLEGACY(Forward=duplicate_data_4, Left=series_2)  # -> Output, Points; inputs Forward: list, Left: list; disabled; same code as turtle
point_9 = Point(turtle_2.Points)  # disabled

interpolate_t_2 = InterpolateT(Vertices=point_9, TangentStart=Vector(0.0625, 0, 0), TangentEnd=Vector(0, 0, 0), KnotStyle=2)  # -> Curve, Length, Domain; disabled
evaluate_length_6 = EvaluateLength(Curve=interpolate_t_2.Curve, Length=1, Normalized=True)  # -> Point, Tangent, Parameter; disabled
line_sdl_8 = LineSDL(Start=evaluate_length_6.Point, Direction=evaluate_length_6.Tangent, Length=1)  # disabled
mirror_4 = Mirror(Geometry=interpolate_t_2.Curve, Plane=line_sdl_8)  # -> Geometry, Transform; disabled
join_curves_5 = JoinCurves(Curves=[interpolate_t_2.Curve, mirror_4.Geometry], Preserve=False)  # disabled
evaluate_length_7 = EvaluateLength(Curve=join_curves_5, Length=1, Normalized=True)  # -> Point, Tangent, Parameter; disabled
rotate_4 = Rotate(Geometry=join_curves_5, Angle=3.141592654, Plane=evaluate_length_7.Point)  # -> Geometry, Transform; disabled
join_curves_6 = JoinCurves(Curves=[join_curves_5, rotate_4.Geometry], Preserve=False)  # disabled
curve_10 = Curve(join_curves_6)  # disabled

expression_24 = Expression(O=turtle_2.Points, Expression="FORMAT(\"{0:R}\",O)")  # disabled
panel_30 = Panel(expression_24)  # disabled
expression_25 = Expression(O=series_2, Expression="FORMAT(\"{0:R}\",O)")  # disabled
panel_31 = Panel(expression_25)  # disabled
evaluate_length_8 = EvaluateLength(Curve=join_curves_6, Length=1, Normalized=True)  # -> Point, Tangent, Parameter; disabled
deconstruct_7 = Deconstruct(Point=evaluate_length_8.Point)  # -> XComponent, YComponent, ZComponent; disabled
expression_26 = Expression(O=deconstruct_7.YComponent, Expression="FORMAT(\"{0:R}\",O)")  # disabled
expression_27 = Expression(O=deconstruct_7.XComponent, Expression="FORMAT(\"{0:R}\",O)")  # disabled
expression_28 = Expression(O=deconstruct_7.ZComponent, Expression="FORMAT(\"{0:R}\",O)")  # disabled
panel_32 = Panel(expression_26)  # disabled
panel_33 = Panel(expression_27)  # disabled
panel_34 = Panel(expression_28)  # disabled
addition_2 = Addition(A=panel_32, B=panel_33)  # disabled
expression_29 = Expression(O=addition_2, Expression="FORMAT(\"{0:R}\",O)")  # disabled
panel_35 = Panel(expression_29)  # disabled
division_3 = Division(A=panel_35, B=2)  # disabled
expression_30 = Expression(O=division_3, Expression="FORMAT(\"{0:R}\",O)")  # disabled
panel_36 = Panel(expression_30)  # disabled
scale_6 = Scale(Geometry=curve_10, Center=Point(0, 0, 0), Factor=expr("1/X", panel_36))  # -> Geometry, Transform; disabled
evaluate_length_9 = EvaluateLength(Curve=scale_6.Geometry, Length=1, Normalized=True)  # -> Point, Tangent, Parameter; disabled
deconstruct_8 = Deconstruct(Point=evaluate_length_9.Point)  # -> XComponent, YComponent, ZComponent; disabled
expression_31 = Expression(O=deconstruct_8.YComponent, Expression="FORMAT(\"{0:R}\",O)")  # disabled
expression_32 = Expression(O=deconstruct_8.XComponent, Expression="FORMAT(\"{0:R}\",O)")  # disabled
expression_33 = Expression(O=deconstruct_8.ZComponent, Expression="FORMAT(\"{0:R}\",O)")  # disabled
panel_37 = Panel(expression_31)  # disabled
panel_38 = Panel(expression_32)  # disabled
panel_39 = Panel(expression_33)  # disabled
division_4 = Division(A=panel_33, B=panel_32)  # disabled
expression_34 = Expression(O=division_4, Expression="FORMAT(\"{0:R}\",O)")  # disabled
panel_40 = Panel(expression_34)  # disabled
curve_11 = Curve(scale_6.Geometry)  # disabled

digit_scroller_5 = DigitScroller(Scroller_Digits=12, Scroller_Prefix=" ", Scroller_Radix=11, Scroller_Value=256)
digit_scroller_6 = DigitScroller(Scroller_Digits=12, Scroller_Prefix=" ", Scroller_Radix=11, Scroller_Value=90)
create_material = CreateMaterial(Diffuse=RGB(222, 222, 222), Specular=RGB(0, 255, 255), Emission=RGB(0, 0, 0), Transparency=0.5, Shine=100)
create_material_2 = CreateMaterial(Diffuse=RGB(247, 247, 247), Specular=RGB(0, 255, 255), Emission=RGB(0, 0, 0), Transparency=0.5, Shine=100)
create_material_3 = CreateMaterial(Diffuse=RGB(176, 176, 176), Specular=RGB(0, 255, 255), Emission=RGB(0, 0, 0), Transparency=0.5, Shine=100)
curve_12 = Curve(graft(nurbs_curve.Curve))
custom_preview = CustomPreview(Geometry=curve_12, Material=create_material_3)
curvature_graph = CurvatureGraph(Curve=curve_12, Density=1, Scale=digit_scroller_6)
number_8 = Number(digit_scroller_5)
divide_curve_6 = DivideCurve(Curve=curve_12, Count=number_8, Kinks=False)  # -> Points, Tangents, Parameters
curvature_2 = Curvature(Curve=curve_12, Parameter=divide_curve_6.Parameters)  # -> Point, Curvature, Curvature_2
deconstruct_arc_2 = DeconstructArc(Arc=curvature_2.Curvature_2)  # -> BasePlane, Radius, Angle
line = Line(StartPoint=curvature_2.Point, EndPoint=deconstruct_arc_2.BasePlane)
one_over_x_4 = OneOverX(Value=deconstruct_arc_2.Radius)
quick_graph_2 = QuickGraph(one_over_x_4, SortOrder=0)
replace_nulls = ReplaceNulls(Items=one_over_x_4, Replacements=0)  # -> Items, Count
relative_differences = RelativeDifferences(Values=replace_nulls.Items)
number_9 = Number(number_8)

expression_35 = Expression(O=relative_differences, Expression="FORMAT(\"{0:R}\",O)")
panel_42 = Panel(expression_35)
quick_graph_3 = QuickGraph(relative_differences, SortOrder=0)

expression_36 = Expression(O=one_over_x_4, Expression="FORMAT(\"{0:R}\",O)")
panel_43 = Panel(expression_36)

expression_37 = Expression(O=deconstruct_arc_2.Radius, Expression="FORMAT(\"{0:R}\",O)")
panel_44 = Panel(expression_37)

bounds = Bounds(Numbers=relative_differences)
remap_numbers = RemapNumbers(Value=relative_differences, Source=bounds, Target=Domain(-1, 1))  # -> Mapped, Clipped

bounds_2 = Bounds(Numbers=one_over_x_4)
remap_numbers_2 = RemapNumbers(Value=one_over_x_4, Source=bounds_2, Target=Domain(0, 1))  # -> Mapped, Clipped

create_material_4 = CreateMaterial(Diffuse=RGB(207, 207, 207), Specular=RGB(0, 255, 255), Emission=RGB(0, 0, 0), Transparency=0.5, Shine=100)
create_material_5 = CreateMaterial(Diffuse=RGB(232, 232, 232), Specular=RGB(0, 255, 255), Emission=RGB(0, 0, 0), Transparency=0.5, Shine=100)
create_material_6 = CreateMaterial(Diffuse=RGB(214, 214, 214), Specular=RGB(0, 255, 255), Emission=RGB(0, 0, 0), Transparency=0.5, Shine=100)
create_material_7 = CreateMaterial(Diffuse=RGB(240, 240, 240), Specular=RGB(0, 255, 255), Emission=RGB(0, 0, 0), Transparency=0.5, Shine=100)
derivatives = Derivatives(Curve=curve_12, Parameter=divide_curve_6.Parameters)  # -> Point, FirstDerivative, SecondDerivative, ThirdDerivative, FourthDerivative, FifthDerivative, SixthDerivative
quick_graph_4 = QuickGraph(derivatives.SixthDerivative, SortOrder=0)
quick_graph_5 = QuickGraph(derivatives.FifthDerivative, SortOrder=0)
quick_graph_6 = QuickGraph(derivatives.FourthDerivative, SortOrder=0)
quick_graph_7 = QuickGraph(derivatives.ThirdDerivative, SortOrder=0)
quick_graph_8 = QuickGraph(derivatives.SecondDerivative, SortOrder=0)
quick_graph_9 = QuickGraph(derivatives.FirstDerivative, SortOrder=0)
quick_graph_10 = QuickGraph(derivatives.Point, SortOrder=0)
length = Length(Curve=curve_12)
multiplication_2 = Multiplication(A=remap_numbers.Mapped, B=length)
multiplication_3 = Multiplication(A=length, B=remap_numbers_2.Mapped)

multiplication_4 = Multiplication(A=multiplication_2, B=Slider(0.452284, range=0..1))

multiplication_5 = Multiplication(A=multiplication_3, B=Slider(0.0625, range=0..2))

line_sdl_9 = LineSDL(Start=curvature_2.Point, Direction=line, Length=expr("-ABS(X)", multiplication_5))
evaluate_length_10 = EvaluateLength(Curve=line_sdl_9, Length=1, Normalized=True)  # -> Point, Tangent, Parameter
interpolate_2 = Interpolate(Vertices=evaluate_length_10.Point, Degree=3, Periodic=False, KnotStyle=2)  # -> Curve, Length, Domain
custom_preview_2 = CustomPreview(Geometry=line_sdl_9, Material=create_material_2)
curve_13 = Curve(interpolate_2.Curve)
custom_preview_3 = CustomPreview(Geometry=curve_13, Material=create_material)

line_sdl_10 = LineSDL(Start=evaluate_length_10.Point, Direction=line_sdl_9, Length=expr("ABS(X)", multiplication_4))
nurbs_curve_2 = NurbsCurve(Vertices=evaluate_length_10.Point, Degree=3, Periodic=False)  # -> Curve, Length, Domain
custom_preview_4 = CustomPreview(Geometry=line_sdl_10, Material=create_material_7)
curve_14 = Curve(line_sdl_10)
evaluate_length_11 = EvaluateLength(Curve=curve_14, Length=1, Normalized=True)  # -> Point, Tangent, Parameter
interpolate_3 = Interpolate(Vertices=evaluate_length_11.Point, Degree=3, Periodic=False, KnotStyle=2)  # -> Curve, Length, Domain
line_sdl_11 = LineSDL(Start=evaluate_length_11.Point, Direction=derivatives.ThirdDerivative, Length=expr("-X", multiplication_4))
evaluate_length_12 = EvaluateLength(Curve=line_sdl_11, Length=1, Normalized=True)  # -> Point, Tangent, Parameter
interpolate_4 = Interpolate(Vertices=evaluate_length_12.Point, Degree=3, Periodic=False, KnotStyle=2)  # -> Curve, Length, Domain
polyline = PolyLine(Vertices=evaluate_length_11.Point, Closed=False)
explode = Explode(Curve=polyline, Recursive=True)  # -> Segments, Vertices
custom_preview_5 = CustomPreview(Geometry=interpolate_4.Curve, Material=create_material_4)
custom_preview_6 = CustomPreview(Geometry=line_sdl_11, Material=create_material_5)
custom_preview_7 = CustomPreview(Geometry=interpolate_3.Curve, Material=create_material_6)
curve_15 = Curve(flatten(explode.Segments))
length_2 = Length(Curve=curve_15)
sort_list = SortList(Keys=length_2, ValuesValuesA=curve_15)  # -> Keys, ValuesValuesA
list_item_2 = ListItem(List=sort_list.Keys, Index=0, Wrap=False)
dot_display = DotDisplay(Point=evaluate_length_11.Point, Colour=RGB(194, 194, 194), Size=expr("X/2", list_item_2))

expression_38 = Expression(O=sort_list.Keys, Expression="FORMAT(\"{0:R}\",O)")
panel_45 = Panel(expression_38)

panel_46 = Panel("0.0014014999884235925")  # disabled
panel_47 = Panel("""1    16    0.35721403168191375
1    256    0.0014014999884235925
1    4096    """)  # disabled
digit_scroller_7 = DigitScroller(Scroller_Digits=12, Scroller_Prefix="Digit Scroller", Scroller_Radix=1, Scroller_Value=0.00140216731)  # disabled
number_slider_4 = Slider(256, range=0..65536)  # disabled
radians_3 = Radians(Degrees=panel_46)  # disabled

expression_39 = Expression(O=radians_3, Expression="FORMAT(\"{0:0.00000000000000000000}\",O)")  # disabled
panel_48 = Panel(expression_39)  # disabled
number_10 = Number(number_slider_4)  # disabled

number_slider_5 = Slider(1, range=0..1)  # disabled
end_points = EndPoints(Curve=curve_2)  # -> Start, End; disabled
rectangle_2pt = Rectangle2Pt(Plane=PlaneXY(0, 0, 0), PointA=end_points.Start, PointB=end_points.End, Radius=0)  # -> Rectangle, Length; disabled

series_3 = Series(Start=0, Step=panel_48, Count=number_10)  # disabled
expression_40 = Expression(O=series_3, Expression="FORMAT(\"{0:R}\",O)")  # disabled
panel_49 = Panel(expression_40)  # disabled
bounds_3 = Bounds(Numbers=panel_49)  # disabled
one_over_x_5 = OneOverX(Value=number_10)  # disabled
duplicate_data_5 = DuplicateData(Data=one_over_x_5, Number=number_10, Order=True)  # disabled

curve_graph_mapper = CurveGraphMapper(Curves=curve_2, Rectangle=rectangle_2pt.Rectangle, Values=series_3, Flip=False, Snap=False, TextSize=0.015625)  # -> Mapped, GraphCurves, GraphPoints, ValueLines, ValuePoints, MappedLines, MappedPoints, Boundary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; disabled
graphmapper = GraphMapper(Curve=curve_2, Boundary=rectangle_2pt.Rectangle, Numbers=series_3, Input=bounds_3, Output=bounds_3, bobo=False)  # disabled
stream_filter_2 = StreamFilter(Gate=number_slider_5, Stream0=curve_graph_mapper.Mapped, Stream1=graphmapper)  # disabled

turtle_3 = DotNETVBScriptLEGACY(Forward=duplicate_data_5, Left=stream_filter_2)  # -> Output, Points; inputs Forward: list, Left: list; disabled; same code as turtle
point_10 = Point(turtle_3.Points)  # disabled

expression_41 = Expression(O=turtle_3.Points, Expression="FORMAT(\"{0:R}\",O)")  # disabled
panel_50 = Panel(expression_41)  # disabled

interpolate_t_3 = InterpolateT(Vertices=point_10, TangentStart=Vector(0.0625, 0, 0), TangentEnd=Vector(0, 0, 0), KnotStyle=2)  # -> Curve, Length, Domain; disabled
evaluate_length_13 = EvaluateLength(Curve=interpolate_t_3.Curve, Length=1, Normalized=True)  # -> Point, Tangent, Parameter; disabled
line_sdl_12 = LineSDL(Start=evaluate_length_13.Point, Direction=evaluate_length_13.Tangent, Length=1)  # disabled
mirror_5 = Mirror(Geometry=interpolate_t_3.Curve, Plane=line_sdl_12)  # -> Geometry, Transform; disabled
join_curves_7 = JoinCurves(Curves=[interpolate_t_3.Curve, mirror_5.Geometry], Preserve=False)  # disabled
evaluate_length_14 = EvaluateLength(Curve=join_curves_7, Length=1, Normalized=True)  # -> Point, Tangent, Parameter; disabled
rotate_5 = Rotate(Geometry=join_curves_7, Angle=3.141592654, Plane=evaluate_length_14.Point)  # -> Geometry, Transform; disabled
join_curves_8 = JoinCurves(Curves=[join_curves_7, rotate_5.Geometry], Preserve=False)  # disabled
curve_16 = Curve(join_curves_8)  # disabled

evaluate_length_15 = EvaluateLength(Curve=join_curves_8, Length=1, Normalized=True)  # -> Point, Tangent, Parameter; disabled
deconstruct_9 = Deconstruct(Point=evaluate_length_15.Point)  # -> XComponent, YComponent, ZComponent; disabled
expression_42 = Expression(O=deconstruct_9.YComponent, Expression="FORMAT(\"{0:R}\",O)")  # disabled
expression_43 = Expression(O=deconstruct_9.XComponent, Expression="FORMAT(\"{0:R}\",O)")  # disabled
expression_44 = Expression(O=deconstruct_9.ZComponent, Expression="FORMAT(\"{0:R}\",O)")  # disabled
panel_51 = Panel(expression_42)  # disabled
panel_52 = Panel(expression_43)  # disabled
panel_53 = Panel(expression_44)  # disabled
addition_3 = Addition(A=panel_51, B=panel_52)  # disabled
expression_45 = Expression(O=addition_3, Expression="FORMAT(\"{0:R}\",O)")  # disabled
panel_54 = Panel(expression_45)  # disabled
division_5 = Division(A=panel_54, B=2)  # disabled
expression_46 = Expression(O=division_5, Expression="FORMAT(\"{0:R}\",O)")  # disabled
panel_55 = Panel(expression_46)  # disabled
scale_7 = Scale(Geometry=point_10, Center=Point(0, 0, 0), Factor=expr("1/X", panel_55))  # -> Geometry, Transform; disabled
scale_8 = Scale(Geometry=curve_16, Center=Point(0, 0, 0), Factor=expr("1/X", panel_55))  # -> Geometry, Transform; disabled
evaluate_length_16 = EvaluateLength(Curve=scale_8.Geometry, Length=1, Normalized=True)  # -> Point, Tangent, Parameter; disabled
deconstruct_10 = Deconstruct(Point=evaluate_length_16.Point)  # -> XComponent, YComponent, ZComponent; disabled
expression_47 = Expression(O=deconstruct_10.YComponent, Expression="FORMAT(\"{0:R}\",O)")  # disabled
expression_48 = Expression(O=deconstruct_10.XComponent, Expression="FORMAT(\"{0:R}\",O)")  # disabled
expression_49 = Expression(O=deconstruct_10.ZComponent, Expression="FORMAT(\"{0:R}\",O)")  # disabled
panel_56 = Panel(expression_47)  # disabled
panel_57 = Panel(expression_48)  # disabled
panel_58 = Panel(expression_49)  # disabled
division_6 = Division(A=panel_52, B=panel_51)  # disabled
expression_50 = Expression(O=division_6, Expression="FORMAT(\"{0:R}\",O)")  # disabled
panel_59 = Panel(expression_50)  # disabled

curve_17 = Curve(scale_8.Geometry)  # disabled

point_11 = Point(scale_7.Geometry)  # disabled
