# Grasshopper definition XHꓨ.𔗢⚪ᙏ⚪ᗩ⚪ᴥ⚪ᕤᕦ⚪ᗩ⚪ᗱᗴ⚪ᗝ⚪ꖴ⚪𖣓⚪✤⚪ᑐᑕ⚪ᗩ⚪✤⚪ᴥ⚪ᗱᗴ⚪✤⚪ИN⚪ꖴ⚪𖣓⚪ᔓᔕ⚪ИN⚪Ⓞ⚪ꖴ⚪✤⚪ꖴ⚪ᑎ⚪✤⚪ИN⚪ꖴ⚪𔗢⚪ꖴ⚪ИN⚪✤⚪ᑎ⚪ꖴ⚪✤⚪ꖴ⚪Ⓞ⚪ИN⚪ᔓᔕ⚪𖣓⚪ꖴ⚪ИN⚪✤⚪ᗱᗴ⚪ᴥ⚪✤⚪ᗩ⚪ᑐᑕ⚪✤⚪𖣓⚪ꖴ⚪ᗝ⚪ᗱᗴ⚪ᗩ⚪ᕤᕦ⚪ᴥ⚪ᗩ⚪ᙏ⚪𔗢.GHX (Grasshopper 1.0.7)
# plug-ins: Kangaroo2 Components, CORE.Toolbox.Grasshopper, Anemone, GraphicPlus, Pancake

digit_scroller = DigitScroller(Scroller_Digits=12, Scroller_Prefix=" ", Scroller_Radix=11, Scroller_Value=8)
digit_scroller_2 = DigitScroller(Scroller_Digits=12, Scroller_Prefix=" ", Scroller_Radix=11, Scroller_Value=0)
polygon = Polygon(Plane=PlaneXY(0, 0, 0), Radius=1, Segments=digit_scroller, FilletRadius=0)  # -> Polygon, Length
control_polygon = ControlPolygon(Curve=polygon.Polygon)  # -> Polygon, Points
fast_loop_start = FastLoopStart(Iterations=digit_scroller_2, Data=control_polygon.Points)  # -> port, Counter, Data, Data_2
cull_duplicates = CullDuplicates(Points=fast_loop_start.Data, Tolerance=1.164153218e-10, CullMode=1)  # -> Points, Indices, Valence
interconnectpoints = InterconnectPoints(Pts=cull_duplicates.Points)
clean_duplicate_lines = CleanDuplicateLines(Lines=interconnectpoints, Tolerance=1.164153218e-10)  # -> Lines, Indices, Status
multiple_curves = MultipleCurves(Curves=clean_duplicate_lines.Lines)  # -> Points, IndexA, IndexB, ParamA, ParamB
cull_duplicates_2 = CullDuplicates(Points=multiple_curves.Points, Tolerance=1.164153218e-10, CullMode=1)  # -> Points, Indices, Valence
fast_loop_end = FastLoopEnd(
    port=fast_loop_start.port,
    Exit=False,
    Data=cull_duplicates_2.Points,
    Data_2=clean_duplicate_lines.Lines,
    RecordData=False,
    TimeOutVal=0)  # -> Data, D1
point = Point(fast_loop_end.Data)  # disabled
curve = Curve(fast_loop_end.D1)
curve_2 = Curve([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])
dot_display = DotDisplay(Point=point, Colour=RGB(0, 242, 255), Size=expr("1/1024", 0.00390625))  # disabled
digit_scroller_3 = DigitScroller(Scroller_Digits=12, Scroller_Radix=11, Scroller_Value=16382)
stroke = Stroke(ShapeGeometry=curve, Color=ColourSwatch(SwatchColor=RGB(182, 182, 182)), Weight=2, EndCap=2)
stroke_2 = Stroke(ShapeGeometry=curve_2, Color=ColourSwatch(SwatchColor=RGBA(184, 184, 184, 85)), Weight=1, EndCap=2)
construct_drawing = ConstructDrawing(ShapesGeometry=stroke, Width=digit_scroller_3, Height=digit_scroller_3, Color=RGBA(255, 255, 255, 0))  # -> Drawing, Boundary
construct_drawing_2 = ConstructDrawing(ShapesGeometry=stroke_2, Width=digit_scroller_3, Height=digit_scroller_3, Color=RGBA(255, 255, 255, 0))  # -> Drawing, Boundary
true_only_button = TrueOnlyButton(LastSaveLocalization="neutral,N")
save_svg = SaveSvg(DrawingsShapesGeometry=construct_drawing.Drawing, FolderPath="C:\", FileName="GVS.0.SVG", Save=true_only_button)
save_svg_2 = SaveSvg(DrawingsShapesGeometry=construct_drawing_2.Drawing, FolderPath="C:\", FileName="GVS.1.SVG", Save=true_only_button)
shape_preview_beta = ShapePreviewBeta(DrawingsShapesGeometry=construct_drawing.Drawing)
shape_preview_beta_2 = ShapePreviewBeta(DrawingsShapesGeometry=construct_drawing_2.Drawing)
drawing_viewer = DrawingViewer(DrawingsShapesGeometry=construct_drawing.Drawing, Resolution=0)  # disabled
drawing_viewer_2 = DrawingViewer(DrawingsShapesGeometry=construct_drawing_2.Drawing, Resolution=0)  # disabled
