# Grasshopper definition XHG.⠀⠀⠀⠀◯⠀∞⁂ᐃⵔ꞉ⵘ❋ⵔⵔ⁂❋❋ⵔ❋·⁂❋❋ⵈ⁂❋ⵔ⁂❋꞉ⵔⵔⵔ·⁂ⵔ꞉⁂ⵔᐃ··⁂⁂❋❋⠿ᐃⵔⵈⵔ∷ⵘ⁂⁂❋ⵘ꞉꞉ⵔ⠿ⵔ∷◌∷❋⠀◯⠀⠀⠀⠀ⵙ⠀⠀⠀⠀◯⠀❋∷◌∷ⵔ⠿ⵔ꞉꞉ⵘ❋⁂⁂ⵘ∷ⵔⵈⵔᐃ⠿❋❋⁂⁂··ᐃⵔ⁂꞉ⵔ⁂·ⵔⵔⵔ꞉❋⁂ⵔ❋⁂ⵈ❋❋⁂·❋ⵔ❋❋⁂ⵔⵔ❋ⵘ꞉ⵔᐃ⁂∞⠀◯⠀⠀⠀⠀.GHX (Grasshopper 1.0.7)
# plug-ins: Firefly.X

ᗱᗴᕤᕦᗩᔓᔕᗩᑫᑭ_옷ᕤᕦ_ᙁ_ᔓᔕᴥᗱᗴ_ᗱᗴᙏ_ᙏᗱᗴ_ᗱᗴᴥᔓᔕ_ᙁ_ᕤ = Panel("299792458*(1/(1/84.406022589954030768899117092091000289089388918088900852079*3^12))")  # "◯ᗱᗴᕤᕦᗩᔓᔕᗩᑫᑭ◯✤옷ᕤᕦ⊙ᙁ◯ᔓᔕᴥᗱᗴ✤ᗱᗴᙏ◯⦿◯ᙏᗱᗴ✤ᗱᗴᴥᔓᔕ◯ᙁ⊙ᕤᕦ옷✤◯ᑫᑭᗩᔓᔕᗩᕤᕦᗱᗴ◯"
series = Series(Start=0, Step=1, Count=14)
panel = Panel("84.406022589954030768899117092091000289089388918088900852079/3^6")
ᗝᗱᗴᑫᑭᔓᔕ_옷ᕤᕦ_ᙁ_ᗝиn_ᑐᑕᗱᗴᔓᔕ_ᴥᗱᗴᑫᑭ_ᔓᔕᴥᗱᗴ_ᗱᗴᙏ = Panel("299792458")  # "◯ᗝᗱᗴᑫᑭᔓᔕ◯✤옷ᕤᕦ⊙ᙁ◯ᗝИNⓄᑐᑕᗱᗴᔓᔕ◯ᴥᗱᗴᑫᑭ◯ᔓᔕᴥᗱᗴ✤ᗱᗴᙏ◯⦿◯ᙏᗱᗴ✤ᗱᗴᴥᔓᔕ◯ᑫᑭᗱᗴᴥ◯ᔓᔕᗱᗴᑐᑕⓄИNᗝ◯ᙁ⊙ᕤᕦ옷✤◯ᔓᔕᑫᑭᗱᗴᗝ◯"
人ᑐᑕиnᗱᗴᑎ_ᗱᗴᴥθ_ᔓᔕ_ᴥᗱᗴ옷_옷ᗱᗴᴥ_ᔓᔕ_θᴥᗱᗴ_ᑎᗱᗴиn = Panel("1/84.406022589954030768899117092091000289089388918088900852079*3^12")  # "◯人ᑐᑕИNᗱᗴᑎ¤ᗱᗴᴥΘ◯ᔓᔕ✤ᴥᗱᗴ옷◯⦿◯옷ᗱᗴᴥ✤ᔓᔕ◯Θᴥᗱᗴ¤ᑎᗱᗴИNᑐᑕ人◯"
ᗱᗴᙏ_ᔓᔕᗝиn_ᑐᑕᗱᗴᔓᔕ_ᔓᔕᗱᗴᑐᑕ_иnᗝᔓᔕ_ᙏᗱᗴ = Panel("1/(1/84.406022589954030768899117092091000289089388918088900852079*3^12)")
옷_ᕤᕦиnᗱᗴᙁᗱᗴᗯᗩᗯ_ᔓᔕᗝиn_ᑐᑕᗱᗴᔓᔕ_ᔓᔕᗱᗴᑐᑕ_иnᗝᔓᔕ = Panel("84.406022589954030768899117092091000289089388918088900852079")  # "◯옷✤ᕤᕦИNᗱᗴᙁᗱᗴᗯᗩᗯ◯ᔓᔕᗝИNⓄᑐᑕᗱᗴᔓᔕ◯⦿◯ᔓᔕᗱᗴᑐᑕⓄИNᗝᔓᔕ◯ᗯᗩᗯᗱᗴᙁᗱᗴИNᕤᕦ✤옷◯"
power = Power(A=3, B=series)
division = Division(A=옷_ᕤᕦиnᗱᗴᙁᗱᗴᗯᗩᗯ_ᔓᔕᗝиn_ᑐᑕᗱᗴᔓᔕ_ᔓᔕᗱᗴᑐᑕ_иnᗝᔓᔕ, B=power)
division_2 = Division(A=power, B=옷_ᕤᕦиnᗱᗴᙁᗱᗴᗯᗩᗯ_ᔓᔕᗝиn_ᑐᑕᗱᗴᔓᔕ_ᔓᔕᗱᗴᑐᑕ_иnᗝᔓᔕ)
multiplication = Multiplication(A=division, B=ᗝᗱᗴᑫᑭᔓᔕ_옷ᕤᕦ_ᙁ_ᗝиn_ᑐᑕᗱᗴᔓᔕ_ᴥᗱᗴᑫᑭ_ᔓᔕᴥᗱᗴ_ᗱᗴᙏ)
graft_tree = GraftTree(Tree=division, IncludeEmptyLists=True, IncludeNullItems=True)
graft_tree_2 = GraftTree(Tree=division_2, IncludeEmptyLists=True, IncludeNullItems=True)
graft_tree_3 = GraftTree(Tree=multiplication, IncludeEmptyLists=True, IncludeNullItems=True)
panel_2 = Panel(division)
panel_3 = Panel(multiplication)
panel_4 = Panel(division_2)
panel_5 = Panel([graft_tree, graft_tree_2, graft_tree_3])
number = Number(人ᑐᑕиnᗱᗴᑎ_ᗱᗴᴥθ_ᔓᔕ_ᴥᗱᗴ옷_옷ᗱᗴᴥ_ᔓᔕ_θᴥᗱᗴ_ᑎᗱᗴиn)
number_2 = Number(ᗱᗴᙏ_ᔓᔕᗝиn_ᑐᑕᗱᗴᔓᔕ_ᔓᔕᗱᗴᑐᑕ_иnᗝᔓᔕ_ᙏᗱᗴ)
number_3 = Number(ᗱᗴᕤᕦᗩᔓᔕᗩᑫᑭ_옷ᕤᕦ_ᙁ_ᔓᔕᴥᗱᗴ_ᗱᗴᙏ_ᙏᗱᗴ_ᗱᗴᴥᔓᔕ_ᙁ_ᕤ)
panel_6 = Panel(number)
panel_7 = Panel(number_2)
panel_8 = Panel(number_3)
numbers_to_points = NumbersToPoints(Numbers=panel_5, Mask=4)
power_2 = Power(A=3, B=Slider(5, range=2..10))
text_tag = TextTag(Location=numbers_to_points, Text=numbers_to_points)
one_over_x = OneOverX(Value=power_2)
tone_generator = ToneGenerator(AudioFrequency=division_2, Volume=one_over_x, Duration=panel, Repeat=Toggle(False))
