# Grasshopper definition XHG..⠀⠀⠀⠀ⵙ⠀✤⠀ⵙ⠀ᴥ⠀ⵙ⠀ᗩ⠀ⵙ⠀옷⠀ⵙ⠀ᑐᑕ⠀ⵙ⠀◯⠀ⵙ⠀⁂⠀ⵙ⠀△⠀ⵙ⠀ⵈ⠀ⵙ⠀⠀⠀⠀◯⠀⠀⠀⠀ⵙ⠀⠀⠀⠀◯⠀⠀⠀⠀ⵙ⠀ⵈ⠀ⵙ⠀△⠀ⵙ⠀⁂⠀ⵙ⠀◯⠀ⵙ⠀ᑐᑕ⠀ⵙ⠀옷⠀ⵙ⠀ᗩ⠀ⵙ⠀ᴥ⠀ⵙ⠀✤⠀ⵙ⠀⠀⠀⠀..GHX (Grasshopper 1.0.7)
# plug-ins: Firefly.X, CurvePlus, TT Toolbox, Pancake, Wombat, Kangaroo2 Components, Pufferfish, NGon, Yellow, MeshEdit Components

panel = Panel("84.406022589954030768899117092091000289089388918088900852079")
evaluate = Evaluate(Expression="Format(\"{0:0.00000000}\", X)", X=panel)
number = Number(panel)
panel_2 = Panel("14")
panel_3 = Panel(evaluate)
panel_4 = Panel("84.406022589954030768899117092091000289089388918088900852079")
one_over_x = OneOverX(Value=Slider(25, range=1..65))
panel_5 = Panel(number)
series = Series(Start=0, Step=1, Count=379)
expression = Expression(O=series, Expression="((3^(1/3^3))^O)/84.406022589954030768899117092091000289089388918088900852079")
series_2 = Series(Start="0", Step="1", Count=Slider(351, range=1..1025))
power = Power(A=3, B=one_over_x)
power_2 = Power(A=power, B=series_2)
panel_6 = Panel(expression)
division = Division(A=panel_4, B=power_2)
multiplication = Multiplication(A=division, B="299792458")
graft_tree = GraftTree(Tree=multiplication, IncludeEmptyLists=True, IncludeNullItems=True)
graft_tree_2 = GraftTree(Tree=division, IncludeEmptyLists=True, IncludeNullItems=True)
division_2 = Division(A=power_2, B=panel_4)
graft_tree_3 = GraftTree(Tree=division_2, IncludeEmptyLists=True, IncludeNullItems=True)
evaluate_2 = Evaluate(Expression="Format(\"{0:0.0000000000000000}\", X)", X=expression)
panel_7 = Panel(evaluate_2)
power_3 = Power(A="9", B="0")
division_3 = Division(A=panel_4, B=power_3)
one_over_x_2 = OneOverX(Value=power_3)
construct_point = ConstructPoint(XCoordinate=0, YCoordinate=graft_tree_2, ZCoordinate=0)
panel_8 = Panel("""28160.0000000000000000 
26579.5006451166000000 
25087.7079028320000000 
23679.6430535447000000 
22350.6068117123000000 
21096.1636424237000000 
19912.1269582132000000 
18794.5451467141000000 
17739.6883825199000000 
16744.0361792384000000 
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""")
panel_9 = Panel([graft_tree_2, graft_tree_3, graft_tree])
panel_10 = Panel("""-0.0009967000000000 
-3.6736000000000000 
-0.0009967000000000 
-0.0009967000000000 
-0.0009967000000000 
-5.7216000000000000 
-0.0009967000000000 
-7.6629330000000000 
-11.1104000000000000 
-13.5850670000000000 
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""")
text_split = TextSplit(Text=panel_8, Separators=" ")
panel_11 = Panel(text_split)
numbers_to_points = NumbersToPoints(Numbers=panel_9, Mask=4)
digit_scroller = DigitScroller(Scroller_Digits=12, Scroller_Prefix="Digit Scroller", Scroller_Radix=11, Scroller_Value=378)
expression_2 = Expression(O=digit_scroller, Expression="((3^(1/3^3))^O)/84.406022589954030768899117092091000289089388918088900852079")
line = Line(StartPoint=Point(0, 0, 0), EndPoint=construct_point)
spiral_rail = SpiralRail(Curve=line, Angle=0, Turns=1, BaseRadius=construct_point, PeakRadius=construct_point, SamplePoint=256)
text_split_2 = TextSplit(Text=panel_10, Separators=" ")
panel_12 = Panel(text_split_2)
xz_plane = XZPlane(Origin=Point(0, 0, 0))
rotate = Rotate(Geometry=spiral_rail, Angle=1.570796327, Plane=xz_plane)  # -> Geometry, Transform
text_tag = TextTag(Location=construct_point, Text=numbers_to_points, Colour=RGB(212, 212, 212))
tone_generator = ToneGenerator(AudioFrequency=expression_2, Volume=one_over_x_2, Duration=division_3, Repeat=Toggle(True))
panel_13 = Panel(expression_2)
number_2 = Number(panel_12)
division_4 = Division(A=number_2, B=20)
power_4 = Power(A=10, B=division_4)
panel_14 = Panel(power_4)

number_slider = Slider(0, range=0..90)
range = Range(Domain=Domain(0, 1), Steps=Slider(8, range=1..10))
range_2 = Range(Domain=Domain(0, 1), Steps=Slider(1, range=1..11))
number_3 = Number(263.7690326)
square_root = SquareRoot(Value=2)
B = B(1.5)
B_2 = B(1.5)

file_path = FilePath("C:\ƧLX...⠀⠀⠀⠀ⵙ✤ᴥᗩ옷ᑐᑕⵙᗝᙁⓄ옷ᔓᔕᗱᗴᴥ옷✤ⵙ人✤ꖴᙁᗩꖴИNᗱᗴᕤᕦИNⓄᑐᑕⵙ人ᑐᑕИNᗱᗴᑎ¤ᗱᗴᴥꗳⵙ⠀⠀⠀⠀◯⠀⠀⠀⠀ⵙ⠀⠀⠀⠀◯⠀⠀⠀⠀ⵙꗳᴥᗱᗴ¤ᑎᗱᗴИNᑐᑕ人ⵙᑐᑕⓄИNᕤᕦᗱᗴИNꖴᗩᙁꖴ✤人ⵙ✤옷ᴥᗱᗴᔓᔕ옷Ⓞᙁᗝⵙᑐᑕ옷ᗩᴥ✤ⵙ⠀⠀⠀⠀...XLS")
worksheet_name = WorksheetName("ⵙⓄᴥߦⵙⵔⵔⵘⵈⵙ옷ᴥⵙ◯ⵙ◯ⵙᴥ옷ⵙⵈⵘⵔⵔⵙߦᴥⓄⵙ")
worksheet_name_2 = WorksheetName("ⵙⓄᴥߦⵙⵔⵔⵘⵈⵙ옷ᴥⵙ◯ⵙ◯ⵙᴥ옷ⵙⵈⵘⵔⵔⵙߦᴥⓄⵙ")
number_slider_2 = Slider(1, range=0..1)
file_path_2 = FilePath("C:\ƧLX...⠀⠀⠀⠀ⵙ✤ᴥᗩ옷ᑐᑕⵙᗝᙁⓄ옷ᔓᔕᗱᗴᴥ옷✤ⵙ人✤ꖴᙁᗩꖴИNᗱᗴᕤᕦИNⓄᑐᑕⵙ人ᑐᑕИNᗱᗴᑎ¤ᗱᗴᴥꗳⵙ⠀⠀⠀⠀◯⠀⠀⠀⠀ⵙ⠀⠀⠀⠀◯⠀⠀⠀⠀ⵙꗳᴥᗱᗴ¤ᑎᗱᗴИNᑐᑕ人ⵙᑐᑕⓄИNᕤᕦᗱᗴИNꖴᗩᙁꖴ✤人ⵙ✤옷ᴥᗱᗴᔓᔕ옷Ⓞᙁᗝⵙᑐᑕ옷ᗩᴥ✤ⵙ⠀⠀⠀⠀...XLS")
read_excel_sheet = ReadExcelSheet(Run=True, FilePath=file_path, Worksheet="1", Listen=True)  # -> UserMessages, Columns, Rows
read_excel_sheet_2 = ReadExcelSheet(Run=True, FilePath=file_path_2, Worksheet="2", Listen=True)  # -> UserMessages, Columns, Rows
panel_15 = Panel("FORMAT(\"{0:0.0000000000000000000}\",O)")
number_slider_3 = Slider(100, range=0..100)
number_slider_4 = Slider(1, range=0..256)
number_slider_5 = Slider(2, range=0..10)
number_slider_6 = Slider(2, range=0..10)
number_4 = Number([2, 4])

data = Data(read_excel_sheet.Columns)
data_2 = Data(read_excel_sheet_2.Columns)

panel_16 = Panel(data)
panel_17 = Panel(data_2)
explode_tree = ExplodeTree(Data=panel_16)  # -> Branch0, Branch1, Branch2, Branch3, Branch4, Branch5
explode_tree_2 = ExplodeTree(Data=panel_17)  # -> Branch0, Branch1, Branch2, Branch3, Branch4, Branch5
cull_index = CullIndex(List=explode_tree.Branch4, Indices=[0, 1, 2, 3, 4], Wrap=True)
cull_index_2 = CullIndex(List=explode_tree.Branch2, Indices=[0, 1, 2, 3, 4], Wrap=True)
cull_index_3 = CullIndex(List=explode_tree_2.Branch1, Indices=[0, 1, 2, 3], Wrap=True)
cull_index_4 = CullIndex(List=explode_tree_2.Branch0, Indices=[0, 1, 2, 3], Wrap=True)
panel_18 = Panel(cull_index)
panel_19 = Panel(cull_index_2)
panel_20 = Panel(cull_index_3)
panel_21 = Panel(cull_index_4)
stream_filter = StreamFilter(Gate=number_slider_2, Stream0=panel_18, Stream1=panel_20)
stream_filter_2 = StreamFilter(Gate=number_slider_2, Stream0=panel_19, Stream1=panel_21)
number_5 = Number(stream_filter)
number_6 = Number(stream_filter_2)
evaluate_3 = Evaluate(Expression=panel_15, O=number_5)
panel_22 = Panel(number_6)
evaluate_4 = Evaluate(Expression=panel_15, O=number_6)
number_7 = Number(evaluate_3)
panel_23 = Panel(evaluate_3)
panel_24 = Panel(evaluate_4)
stream_gate = StreamGate(Stream=panel_24, Gate=number_slider_2)  # -> Target0, Target1, Target2
logarithm = Logarithm(Value=stream_gate.Target0)
multiplication_2 = Multiplication(A=logarithm, B=20)
panel_25 = Panel(logarithm)
panel_26 = Panel(multiplication_2)
list_length = ListLength(List=panel_23)
subtraction = Subtraction(A=list_length, B=1)
stream_filter_3 = StreamFilter(Gate=number_slider_2, Stream0=panel_26, Stream1=stream_gate.Target1, Stream2=stream_gate.Target2)
list_item = ListItem(List=panel_23, Index=subtraction, Wrap=True)
list_item_2 = ListItem(List=panel_23, Index=0, Wrap=True)
construct_domain = ConstructDomain(DomainStart=list_item, DomainEnd=list_item_2)
range_3 = Range(Domain=construct_domain, Steps=subtraction)
list_item_3 = ListItem(List=range_3, Index=0, Wrap=True)
list_item_4 = ListItem(List=range_3, Index=1, Wrap=True)
subtraction_2 = Subtraction(A=list_item_4, B=list_item_3)
division_5 = Division(A=subtraction_2, B=4)
multiplication_3 = Multiplication(A=division_5, B=2)
panel_27 = Panel(range_3)
construct_point_2 = ConstructPoint(XCoordinate=panel_27, YCoordinate=0, ZCoordinate=0)
multiplication_4 = Multiplication(A=stream_filter_3, B=number_3)
panel_28 = Panel(multiplication_4)
sphere = Sphere(Base=construct_point_2, Radius=division_5)
line_sdl = LineSDL(Start=construct_point_2, Direction=Vector(0, 14645.1875, 0), Length=multiplication_4)
pipe = Pipe(Curve=line_sdl, Radius=division_5, Caps=2)
panel_29 = Panel(panel_28)
panel_30 = Panel(line_sdl)
ellipse = Ellipse(Plane=construct_point_2, Radius1=division_5, Radius2=panel_29)  # -> Ellipse, Focus1, Focus2
scale_nu = ScaleNU(Geometry=ellipse.Ellipse, Plane=construct_point_2, ScaleX=1, ScaleY=number_4, ScaleZ=1)  # -> Geometry, Transform
bounding_box = BoundingBox(Content=ellipse.Ellipse, Plane=PlaneXY(0, 0, 0))  # -> Box, Box_2
deconstruct_box = DeconstructBox(Box=bounding_box.Box)  # -> Plane, X, Y, Z
deconstruct_domain = DeconstructDomain(Domain=deconstruct_box.X)  # -> Start, End
subtraction_3 = Subtraction(A=deconstruct_domain.End, B=deconstruct_domain.Start)
panel_31 = Panel(subtraction_3)
deconstruct_domain_2 = DeconstructDomain(Domain=deconstruct_box.Y)  # -> Start, End
vector_xyz = VectorXYZ(XComponent=0, YComponent=deconstruct_domain_2.Start, ZComponent=0)  # -> Vector, Length
move = Move(Geometry=ellipse.Ellipse, Motion=vector_xyz.Vector)  # -> Geometry, Transform
rotate_direction = RotateDirection(Geometry=move.Geometry, Center=construct_point_2, From=Vector(2973.3125, 0, 0), To=Vector(0, 0, -1425.375))  # -> Geometry, Transform
divide_curves_on_intersects = DivideCurvesOnIntersects(Curves=[move.Geometry, rotate_direction.Geometry], Tolerance=0)
list_length_2 = ListLength(List=divide_curves_on_intersects)
division_6 = Division(A=list_length_2, B=2)
construct_domain_2 = ConstructDomain(DomainStart=0, DomainEnd=division_6)
subtraction_4 = Subtraction(A=division_6, B=1)
range_4 = Range(Domain=subtraction_4, Steps=subtraction_4)
cull_index_5 = CullIndex(List=divide_curves_on_intersects, Indices=range_4, Wrap=True)
cull_nth = CullNth(List=cull_index_5, CullFrequency=2)
list_item_5 = ListItem(List=cull_nth, Index=Slider(65, range=0..378), Wrap=True)
curve = Curve(cull_nth)
end_points = EndPoints(Curve=curve)  # -> Start, End
panel_32 = Panel(cull_nth)
line_2 = Line(StartPoint=end_points.Start, EndPoint=end_points.End)
revolution = Revolution(Curve=curve, Axis=line_2, Domain=Domain(0, 6.283185307))
bounding_box_2 = BoundingBox(Content=revolution, Plane=PlaneXY(0, 0, 0), UnionBox=True)  # -> Box, Box_2

panel_33 = Panel(division_5)
mesh_pipe = MeshPipe(Curve=line_sdl, Radius=division_5, Segments=Slider(8, range=0..10), Accuracy=1, CapType=3, Faceted=False)
mesh_explode = MeshExplode(Mesh=mesh_pipe, Interpolate=False)
list_item_6 = ListItem(List=line_sdl, Index=Slider(138, range=0..378), Wrap=True)
parameter_pipe_mesh = ParameterPipeMesh(
    Curve=line_sdl,
    Radius=division_5,
    ParametersU=range_2,
    ParametersV=range,
    Weighted=False,
    Lengths=False,
    Angle=0,
    Rotation=0,
    EndType=2,
    Triangulate=False)
bounding_box_3 = BoundingBox(Content=line_sdl, Plane=PlaneXY(0, 0, 0), UnionBox=True)  # -> Box, Box_2
panel_34 = Panel(mesh_pipe)
cad_exporter = CADExporter(Export=False, ExportType="DXF", FilePaths="C:\", FileNames="FXD.DXF", Curves=line_sdl)
panel_35 = Panel(parameter_pipe_mesh)
mesh_explode_2 = MeshExplode(Mesh=parameter_pipe_mesh, Interpolate=False)
deconstruct_box_2 = DeconstructBox(Box=bounding_box_3.Box)  # -> Plane, X, Y, Z
deconstruct_domain_3 = DeconstructDomain(Domain=deconstruct_box_2.X)  # -> Start, End
deconstruct_domain_4 = DeconstructDomain(Domain=deconstruct_box_2.Y)  # -> Start, End
stream_filter_4 = StreamFilter(Gate=Slider(0, range=0..1), Stream0=mesh_pipe, Stream1=parameter_pipe_mesh)
absolute = Absolute(Value=deconstruct_domain_3.End)
absolute_2 = Absolute(Value=deconstruct_domain_3.Start)
absolute_3 = Absolute(Value=deconstruct_domain_4.Start)
absolute_4 = Absolute(Value=deconstruct_domain_4.End)
addition = Addition(A=absolute_2, B=absolute)
addition_2 = Addition(A=absolute_3, B=absolute_4)
division_7 = Division(A=addition_2, B=addition)
division_8 = Division(A=addition, B=addition_2)
panel_36 = Panel(division_8)
panel_37 = Panel(division_7)
brep = Brep(revolution)
group = Group(Objects=brep)
group_2 = Group(Objects=stream_filter_4)

number_slider_7 = Slider(10, range=0..10)
construct_point_3 = ConstructPoint(XCoordinate=0, YCoordinate=0, ZCoordinate=0)
division_9 = Division(A=number_slider_7, B="3")
import_obj = ImportOBJ(File="C:\JBO.PIH.FXD.FXD.DXF.DXF.HIP.OBJ", MapYtoZ=False, LastSaveLocalization="neutral,N")
ⵙ人ⵙᴥⵙ_ⵙᗱᗴⵙᙏⵙ_ⵙᗱᗴⵙᕤᕦⵙ_ⵙ_ⵙᕤᕦⵙᗱᗴⵙ_ⵙᙏⵙᗱᗴⵙ_ⵙᴥ = Slider(1, range=0..1)  # "ⵙ人ⵙᴥⵙ✤ⵙᗱᗴⵙᙏⵙⓄⵙᗱᗴⵙᕤᕦⵙ◯ⵙ◯ⵙᕤᕦⵙᗱᗴⵙⓄⵙᙏⵙᗱᗴⵙ✤ⵙᴥⵙ人ⵙ"
ⵙꕤⵙ_ⵙᴥⵙ_ⵙᴥⵙꖴⵙᙏⵙ_ⵙ_ⵙᙏⵙꖴⵙᴥⵙ_ⵙᴥⵙ_ⵙꕤⵙ = Slider(1, range=0..1)
ⵙꕤⵙ_ⵙ8ⵙ_ⵙᕤᕦⵙиnⵙꖴⵙᗝⵙиnⵙᑎⵙ_ⵙ8ⵙ_ⵙ_ⵙ8ⵙ_ⵙᑎⵙиn = Slider(0, range=0..1)  # "ⵙꕤⵙⓄⵙ8ⵙ◯ⵙᕤᕦⵙИNⵙꖴⵙᗝⵙИNⵙᑎⵙⓄⵙ8ⵙ◯ⵙ◯ⵙ8ⵙⓄⵙᑎⵙИNⵙᗝⵙꖴⵙИNⵙᕤᕦⵙ◯ⵙ8ⵙⓄⵙꕤ"
cone = Cone(Base=PlaneYZ(0, 0, 0), Radius=20, Length=80)  # -> Cone, Tip
weldmesh = WeldMesh(Mesh=import_obj, Radius=1e-10, Align=False, Use_RTree=False)
division_10 = Division(A=number_slider_7, B="9")
multiplication_5 = Multiplication(A=number_slider_7, B="sqrt(3)")
spiral = Spiral(
    BasePlane=Plane(origin=(0, 0, 0), x=(0, 1, 0), y=(-1, 0, 0)),
    Angle=31.41592654,
    Turns=division_10,
    BaseRadius=multiplication_5,
    PeakRadius=division_9)
pipe_2 = Pipe(Curve=spiral, Radius=number_slider_7, Caps=2)
multipipe = MultiPipe(
    Curves=spiral,
    NodeSize=division_10,
    EndOffset=division_9,
    StrutSize=division_10,
    Segment=0,
    KinkAngle=0.6,
    CubeFit=0,
    Caps=1)
stream_filter_5 = StreamFilter(Gate=Slider(1, range=0..2), Stream0=import_obj, Stream1=group_2, Stream2=multipipe)
geometry = Geometry(stream_filter_5)
bounding_box_4 = BoundingBox(Content=geometry, Plane=PlaneXY(0, 0, 0), UnionBox=True)  # -> Box, Box_2
center_geometry_at_origin = CenterGeometryAtOrigin(Geometry=bounding_box_4.Box)  # -> RecenteredGeometry, TranslationVector
stream_filter_6 = StreamFilter(Gate=ⵙꕤⵙ_ⵙ8ⵙ_ⵙᕤᕦⵙиnⵙꖴⵙᗝⵙиnⵙᑎⵙ_ⵙ8ⵙ_ⵙ_ⵙ8ⵙ_ⵙᑎⵙиn, Stream1=bounding_box_4.Box)
stream_filter_7 = StreamFilter(Gate=ⵙ人ⵙᴥⵙ_ⵙᗱᗴⵙᙏⵙ_ⵙᗱᗴⵙᕤᕦⵙ_ⵙ_ⵙᕤᕦⵙᗱᗴⵙ_ⵙᙏⵙᗱᗴⵙ_ⵙᴥ, Stream1=geometry)
move_2 = Move(Geometry=[stream_filter_7, stream_filter_6], Motion=center_geometry_at_origin.TranslationVector)  # -> Geometry, Transform
export_file_to_path = ExportFileToPath(Run=Toggle(False), GeometryToExport=move_2.Geometry, ExportPath="C:\T888......OBJ")
bounding_box_5 = BoundingBox(Content=move_2.Geometry, Plane=PlaneXY(0, 0, 0), UnionBox=True)  # -> Box, Box_2
geometry_2 = Geometry(move_2.Geometry)
deconstruct_box_3 = DeconstructBox(Box=bounding_box_5.Box)  # -> Plane, X, Y, Z
deconstruct_domain_5 = DeconstructDomain(Domain=deconstruct_box_3.Y)  # -> Start, End
deconstruct_domain_6 = DeconstructDomain(Domain=deconstruct_box_3.Z)  # -> Start, End
deconstruct_domain_7 = DeconstructDomain(Domain=deconstruct_box_3.X)  # -> Start, End
line_3 = Line(Line((-299.7957001, 0, 0), (-299.7957001, -99.65670013, 0)))
line_4 = Line(Line((-99.65670013, 0, 0), (-99.65670013, -0.001, 0)))
geometry_3 = Geometry(<mesh referenced from the Rhino model>)
reduce_mesh = ReduceMesh(Mesh=geometry_3, FaceCount=0, Accuracy=10, FaceType=1, Distort=False, Normalize=False)  # -> Reduced, CountDifference
move_3 = Move(Geometry=reduce_mesh.Reduced, Motion=Vector(-457.5, 0, 238.875))  # -> Geometry, Transform
taper = Taper(
    Geometry=reduce_mesh.Reduced,
    Axis=Line((-299.7957001, 0, 0), (-99.65670013, 0, 0)),
    Start=line_3,
    End=line_4,
    Flat=False,
    Infinite=False,
    Rigid=False)
move_4 = Move(Geometry=taper, Motion=Vector(-199.3134003, 0, 0))  # -> Geometry, Transform
scale_nu_2 = ScaleNU(Geometry=taper, Plane=PlaneXY(-1670.120177, 0, 0), ScaleX=0.7071067812, ScaleY=1, ScaleZ=1)  # -> Geometry, Transform

mesh_join = MeshJoin(Meshes=import_obj)
yz_plane = YZPlane(Origin=Point(0, 0, 0))
mirror_cut_mesh = MirrorCutMesh(
    Mesh=mesh_join,
    MirrorPlane=yz_plane,
    Reach=0,
    Offset=0,
    Flip=False,
    Join=False,
    Keep=False,
    ConnectionType=2,
    Bulge=0,
    Divisions=0,
    WeldVertices=0)  # -> MirrorCut, SplitIndex, ReachPlane, OffsetPlane, Intersected
mirror = Mirror(Geometry=mirror_cut_mesh.MirrorCut, Plane=PlaneYZ(0, 0, 0))  # -> Geometry, Transform
mesh_join_2 = MeshJoin(Meshes=[mirror.Geometry, mirror_cut_mesh.MirrorCut])

division_11 = Division(A=division_5, B=deconstruct_domain_7.End)
addition_3 = Addition(A=division_11, B=1)
division_12 = Division(A=division_11, B=1)
addition_4 = Addition(A=division_12, B=1)
multiplication_6 = Multiplication(A=division_12, B=1.5)
addition_5 = Addition(A=multiplication_6, B=1)
multiplication_7 = Multiplication(A=addition_5, B=Slider(4, range=0..12))
multiplication_8 = Multiplication(A=addition_3, B=Slider(4, range=0..6))
multiplication_9 = Multiplication(A=addition_4, B=B)
multiplication_10 = Multiplication(A=addition_4, B=B_2)

multiplication_11 = Multiplication(A=deconstruct_domain_7.Start, B=multiplication_9)
multiplication_12 = Multiplication(A=deconstruct_domain_5.Start, B=multiplication_10)
addition_6 = Addition(A=multiplication_11, B=multiplication_12)

multiplication_13 = Multiplication(A=deconstruct_domain_5.Start, B="3")
addition_7 = Addition(A=deconstruct_domain_7.Start, B=multiplication_13)
addition_8 = Addition(A=addition_7, B=deconstruct_domain_6.Start)
addition_9 = Addition(A=multiplication_13, B=addition_8)

vector_xyz_2 = VectorXYZ(XComponent=0, YComponent=addition_7, ZComponent=addition_9)  # -> Vector, Length
move_5 = Move(Geometry=geometry_2, Motion=vector_xyz_2.Vector)  # -> Geometry, Transform

weldmesh_2 = WeldMesh(Mesh=mesh_join_2, Radius=1e-10, Align=False, Use_RTree=False)
multiplication_14 = Multiplication(A=deconstruct_domain_7.End, B=addition_3)

multiplication_15 = Multiplication(A=deconstruct_domain_7.Start, B=multiplication_8)
multiplication_16 = Multiplication(A=deconstruct_domain_5.Start, B=multiplication_7)
addition_10 = Addition(A=multiplication_16, B=multiplication_15)
division_13 = Division(A=addition_10, B=2)
addition_11 = Addition(A=deconstruct_domain_6.Start, B=division_13)
vector_xyz_3 = VectorXYZ(XComponent=multiplication_14, YComponent=addition_6, ZComponent=addition_11)  # -> Vector, Length
move_6 = Move(Geometry=geometry_2, Motion=vector_xyz_3.Vector)  # -> Geometry, Transform
mirror_2 = Mirror(Geometry=move_6.Geometry, Plane=PlaneYZ(0, 0, 0))  # -> Geometry, Transform

stream_filter_8 = StreamFilter(Gate=ⵙꕤⵙ_ⵙᴥⵙ_ⵙᴥⵙꖴⵙᙏⵙ_ⵙ_ⵙᙏⵙꖴⵙᴥⵙ_ⵙᴥⵙ_ⵙꕤⵙ, Stream0=move_5.Geometry, Stream1=[move_6.Geometry, mirror_2.Geometry])

polar_array = PolarArray(Geometry=stream_filter_8, Plane=PlaneXY(0, 0, 0), Count=4, Angle=6.283185307)  # -> Geometry, Transform
rotate_2 = Rotate(Geometry=polar_array.Geometry, Angle=1.570796327, Plane=PlaneYZ(0, 0, 0))  # -> Geometry, Transform
polar_array_2 = PolarArray(Geometry=polar_array.Geometry, Plane=Plane(origin=(0, 0, 0), x=(0, 0, 1), y=(1, 0, 0)), Count=4, Angle=6.283185307)  # -> Geometry, Transform
rotate_3 = Rotate(Geometry=polar_array.Geometry, Angle=1.570796327, Plane=Plane(origin=(0, 0, 0), x=(0, -1, 0), y=(0, 0, 1)))  # -> Geometry, Transform

geometry_4 = Geometry(flatten([polar_array_2.Geometry, rotate_3.Geometry, rotate_2.Geometry]))
bounding_box_6 = BoundingBox(Content=geometry_4, Plane=PlaneXY(0, 0, 0), UnionBox=True)  # -> Box, Box_2
deconstruct_box_4 = DeconstructBox(Box=bounding_box_6.Box)  # -> Plane, X, Y, Z
panel_39 = Panel(deconstruct_box_4.X)
export_file_to_path_2 = ExportFileToPath(Run=Toggle(False), GeometryToExport=geometry_4, ExportPath="C:\JBO.BB42.XHG.FXD.FXD.DXF.DXF.GHX.24BB.OBJ")

ungroup = Ungroup(Group=geometry_4)  # -> flatten(Objects)
mesh_join_3 = MeshJoin(Meshes=ungroup)  # -> flatten(Mesh)

export_as = ExportAs(
    Geometry=mesh_join_3,
    FileLocation="C:\JBO.BB42.XHG.JBO.PIH.FXD.FXD.DXF.DXF.HIP.OBJ.GHX.24BB.OBJ",
    Overwrite=Toggle(False),
    Export=Toggle(False),
    CompMode=False,
    LastSaveLocalization="neutral,N")  # -> OK, ExportCommand
