# Grasshopper definition XHG.⠀⠀⠀⠀⠀ⵙ⠀⁂⠀ⵙ⠀△⠀ⵙ⠀ⵈ⠀ⵙ⠀⠀⠀⠀◯⠀⠀⠀⠀ⵙ⠀⠀⠀⠀◯⠀⠀⠀⠀ⵙ⠀ⵈ⠀ⵙ⠀△⠀ⵙ⠀⁂⠀ⵙ⠀⠀⠀⠀.GHX (Grasshopper 1.0.7)
# plug-ins: Firefly.X, CurvePlus

panel = Panel("84.406022589954030768899117092091000289089388918088900852079")
evaluate = Evaluate(Expression="Format(\"{0:0.00000000}\", X)", X=panel)
number = Number(panel)
panel_2 = Panel("14")
panel_3 = Panel(evaluate)
panel_4 = Panel("84.406022589954030768899117092091000289089388918088900852079")
one_over_x = OneOverX(Value=Slider(25, range=1..65))
panel_5 = Panel(number)
series = Series(Start=0, Step=1, Count=379)
expression = Expression(O=series, Expression="((3^(1/3^3))^O)/84.406022589954030768899117092091000289089388918088900852079")
series_2 = Series(Start="0", Step="1", Count=Slider(351, range=1..1025))
power = Power(A=3, B=one_over_x)
power_2 = Power(A=power, B=series_2)
panel_6 = Panel(expression)
division = Division(A=panel_4, B=power_2)
multiplication = Multiplication(A=division, B="299792458")
graft_tree = GraftTree(Tree=multiplication, IncludeEmptyLists=True, IncludeNullItems=True)
graft_tree_2 = GraftTree(Tree=division, IncludeEmptyLists=True, IncludeNullItems=True)
division_2 = Division(A=power_2, B=panel_4)
graft_tree_3 = GraftTree(Tree=division_2, IncludeEmptyLists=True, IncludeNullItems=True)
evaluate_2 = Evaluate(Expression="Format(\"{0:0.0000000000000000}\", X)", X=expression)
panel_7 = Panel(evaluate_2)
power_3 = Power(A="9", B="0")
division_3 = Division(A=panel_4, B=power_3)
one_over_x_2 = OneOverX(Value=power_3)
construct_point = ConstructPoint(XCoordinate=0, YCoordinate=graft_tree_2, ZCoordinate=0)
panel_8 = Panel("""28160.0000000000000000 
26579.5006451166000000 
25087.7079028320000000 
23679.6430535447000000 
22350.6068117123000000 
21096.1636424237000000 
19912.1269582132000000 
18794.5451467141000000 
17739.6883825199000000 
16744.0361792384000000 
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""")
panel_9 = Panel([graft_tree_2, graft_tree_3, graft_tree])
panel_10 = Panel("""-0.0009967000000000 
-3.6736000000000000 
-0.0009967000000000 
-0.0009967000000000 
-0.0009967000000000 
-5.7216000000000000 
-0.0009967000000000 
-7.6629330000000000 
-11.1104000000000000 
-13.5850670000000000 
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""")
text_split = TextSplit(Text=panel_8, Separators=" ")
panel_11 = Panel(text_split)
numbers_to_points = NumbersToPoints(Numbers=panel_9, Mask=4)
digit_scroller = DigitScroller(Scroller_Digits=12, Scroller_Prefix="Digit Scroller", Scroller_Radix=11, Scroller_Value=378)
expression_2 = Expression(O=digit_scroller, Expression="((3^(1/3^3))^O)/84.406022589954030768899117092091000289089388918088900852079")
line = Line(StartPoint=Point(0, 0, 0), EndPoint=construct_point)
spiral_rail = SpiralRail(Curve=line, Angle=0, Turns=1, BaseRadius=construct_point, PeakRadius=construct_point, SamplePoint=256)
text_split_2 = TextSplit(Text=panel_10, Separators=" ")
panel_12 = Panel(text_split_2)
xz_plane = XZPlane(Origin=Point(0, 0, 0))
rotate = Rotate(Geometry=spiral_rail, Angle=1.570796327, Plane=xz_plane)  # -> Geometry, Transform
text_tag = TextTag(Location=construct_point, Text=numbers_to_points, Colour=RGB(212, 212, 212))
tone_generator = ToneGenerator(AudioFrequency=expression_2, Volume=one_over_x_2, Duration=division_3, Repeat=Toggle(True))
panel_13 = Panel(expression_2)
number_2 = Number(panel_12)
division_4 = Division(A=number_2, B=20)
power_4 = Power(A=10, B=division_4)
panel_14 = Panel(power_4)
