# Grasshopper definition XHꓨ. ⠀⠀ 𐄪 ⠀⠀ ◦︎𖧋◦︎◯◦︎𖧋◦︎⠀⠀  ⚪  ⠀⠀◦︎𖧋◦︎◯◦︎𖧋◦︎ ⠀⠀ 𐄪 ⠀⠀ .GHX (Grasshopper 1.0.7)
# plug-ins: Anemone, Pufferfish, GraphicPlus

rectangle = Rectangle(Plane=PlaneXY(0, 0, 0), XSize=Domain(-0.5, 0.5), YSize=Domain(-0.5, 0.5), Radius=0)  # -> Rectangle, Length
circle = Circle(Plane=PlaneXY(0, 0, 0), Radius=expr(".5/3^1", 0.5))
bounding_rectangle = BoundingRectangle(Geometry=circle, Plane=PlaneXY(0, 0, 0), Axis=0, Slide=0, Union=True)  # -> Bounding, DimensionX, DimensionY
circle_2 = Circle(Plane=PlaneXY(0, 0, 0), Radius=expr(".5", 0.5))
rebuild_curve = RebuildCurve(Curve=rectangle.Rectangle, Count=8, Degree=0, EndTangents=True)
curve_edit_points = CurveEditPoints(Curve=rebuild_curve, Knots=False)  # -> Points, Tangents, Parameters
scale = Scale(Geometry=flatten(bounding_rectangle.Bounding), Center=Point(0, 0, 0), Factor=expr("2^16", 1))  # -> Geometry, Transform
point = Point(Point(0, 0, 0))
cull_duplicates = CullDuplicates(Points=curve_edit_points.Points, Tolerance=7.629394531e-06, CullMode=1)  # -> Points, Indices, Valence
merge = Merge(Data1=point, Data2=cull_duplicates.Points)  # -> flatten(Result)
scale_2 = Scale(Geometry=flatten(circle), Center=Point(0, 0, 0), Factor=expr("2^16", 1))  # -> Geometry, Transform
scale_3 = Scale(Geometry=flatten(cull_duplicates.Points), Center=Point(0, 0, 0), Factor=expr("2^16", 1))  # -> flatten(Geometry), Transform
digit_scroller = DigitScroller(Scroller_Digits=12, Scroller_Prefix=" ", Scroller_Radix=11, Scroller_Value=4)
scale_4 = Scale(Geometry=flatten(cull_duplicates.Points), Center=Point(0, 0, 0), Factor=expr("2^16", 1))  # -> flatten(Geometry), Transform
boundary_surfaces = BoundarySurfaces(Edges=scale_2.Geometry)
fast_loop_start = FastLoopStart(Iterations=digit_scroller, Data=scale.Geometry)  # -> port, Counter, Data
digit_scroller_2 = DigitScroller(Scroller_Digits=12, Scroller_Prefix=" ", Scroller_Radix=11, Scroller_Value=2)
fast_loop_start_2 = FastLoopStart(Iterations=expr("X-1", digit_scroller_2), Data=boundary_surfaces)  # -> port, Counter, Data
scale_5 = Scale(Geometry=flatten(merge), Center=Point(0, 0, 0), Factor=expr("2^16", 1))  # -> flatten(Geometry), Transform
fast_loop_start_3 = FastLoopStart(Iterations=expr("X-1", digit_scroller_2), Data=scale_2.Geometry)  # -> port, Counter, Data
fast_loop_start_4 = FastLoopStart(Iterations=digit_scroller_2, Data=scale_2.Geometry)  # -> port, Counter, Data
power = Power(A="3", B="-1")
scale_6 = Scale(Geometry=graft(fast_loop_start.Data), Center=scale_4.Geometry, Factor=power)  # -> Geometry, Transform
scale_7 = Scale(Geometry=graft(fast_loop_start_2.Data), Center=scale_3.Geometry, Factor=power)  # -> Geometry, Transform
scale_8 = Scale(Geometry=graft(fast_loop_start_3.Data), Center=scale_3.Geometry, Factor=power)  # -> Geometry, Transform
fast_loop_end = FastLoopEnd(port=fast_loop_start.port, Exit=False, Data=scale_6.Geometry, RecordData=True, TimeOutVal=0)  # -> flatten(Data)
scale_9 = Scale(Geometry=graft(fast_loop_start_4.Data), Center=scale_5.Geometry, Factor=power)  # -> Geometry, Transform
fast_loop_end_2 = FastLoopEnd(port=fast_loop_start_3.port, Exit=False, Data=scale_8.Geometry, RecordData=True, TimeOutVal=0)
fast_loop_end_3 = FastLoopEnd(port=fast_loop_start_2.port, Exit=False, Data=scale_7.Geometry, RecordData=True, TimeOutVal=0)
merge_2 = Merge(Data1=scale.Geometry, Data2=fast_loop_end)  # -> flatten(Result)
merge_3 = Merge(Data1=boundary_surfaces, Data2=fast_loop_end_3)  # -> flatten(Result)
scale_10 = Scale(Geometry=flatten(merge_3), Center=Point(0, 0, 0), Factor=expr("1/2^16", 1))  # -> Geometry, Transform; disabled
fast_loop_end_4 = FastLoopEnd(port=fast_loop_start_4.port, Exit=False, Data=scale_9.Geometry, RecordData=True, TimeOutVal=0)  # -> flatten(Data)
merge_4 = Merge(Data1=scale_2.Geometry, Data2=fast_loop_end_2)  # -> flatten(Result)
scale_11 = Scale(Geometry=flatten(merge_2), Center=Point(0, 0, 0), Factor=expr("1/2^16", 1))  # -> Geometry, Transform
collision_one_many = CollisionOneMany(Collider=flatten(fast_loop_end_4), Obstacles=flatten(merge_3))  # -> Collision, Index
scale_12 = Scale(Geometry=flatten(merge_4), Center=Point(0, 0, 0), Factor=expr("1/2^16", 1))  # -> Geometry, Transform
cull_pattern = CullPattern(List=flatten(fast_loop_end_4), CullPattern=invert(flatten(collision_one_many.Collision)))
stroke = Stroke(ShapeGeometry=flatten(scale_11.Geometry), Color=RGBA(0, 0, 0, 0), Weight=0, EndCap=0)
scale_13 = Scale(Geometry=flatten(cull_pattern), Center=Point(0, 0, 0), Factor=expr("1/2^16", 1))  # -> Geometry, Transform
solid_fill = SolidFill(ShapeGeometry=flatten(stroke), Color=RGB(0, 244, 124))
merge_5 = Merge(Data1=scale_12.Geometry, Data2=scale_13.Geometry)  # -> flatten(Result)
rectangle_2pt = Rectangle2Pt(Plane=PlaneXY(0, 0, 0), PointA=Point(-0.5, -0.5, 0), PointB=Point(0.5, 0.5, 0), Radius=0)  # -> Rectangle, Length
shape_preview_beta = ShapePreviewBeta(DrawingsShapesGeometry=solid_fill)  # disabled
shape_data = ShapeData(ShapeGeometry=solid_fill, ID=" ", Hover=False)
stroke_2 = Stroke(ShapeGeometry=flatten(merge_5), Color=RGBA(0, 0, 0, 0), Weight=0, EndCap=2)
construct_drawing = ConstructDrawing(
    ShapesGeometry=flatten(shape_data),
    Boundary=rectangle_2pt.Rectangle,
    Width=1458,
    Height=1458,
    Color=RGBA(255, 255, 255, 0))  # -> Drawing, Boundary
drawing_viewer = DrawingViewer(DrawingsShapesGeometry=construct_drawing.Drawing, Resolution=96)
solid_fill_2 = SolidFill(ShapeGeometry=flatten(stroke_2), Color=RGB(0, 244, 124))
gradient_radial_fill = GradientRadialFill(ShapeGeometry=flatten(stroke_2), Colors=[RGB(0, 244, 124), RGBA(255, 255, 255, 0)], Parameters=[0, 1])
save_svg = SaveSvg(DrawingsShapesGeometry=construct_drawing.Drawing, FolderPath="C:\", FileName="ϱvƨ", Save=Button())
shape_preview_beta_2 = ShapePreviewBeta(DrawingsShapesGeometry=solid_fill_2)  # disabled
rectangle_2 = Rectangle(Plane=PlaneXY(0, 0, 0), XSize=Domain(-1, 1), YSize=Domain(-2, 2), Radius=0)  # -> Rectangle, Length
shape_data_2 = ShapeData(ShapeGeometry=solid_fill_2, ID=" ", Hover=False)
construct_drawing_2 = ConstructDrawing(
    ShapesGeometry=flatten(shape_data_2),
    Boundary=rectangle.Rectangle,
    Width=1458,
    Height=1458,
    Color=RGBA(255, 255, 255, 0))  # -> Drawing, Boundary
save_svg_2 = SaveSvg(DrawingsShapesGeometry=construct_drawing_2.Drawing, FolderPath="C:\", FileName="ϱvƨ", Save=Button())
drawing_viewer_2 = DrawingViewer(DrawingsShapesGeometry=construct_drawing_2.Drawing, Resolution=96)
