# Grasshopper definition XHꓨ.𖣠⚪ИNⓄⵙ✣ᗩᙏⵙꕤⓄᴥߦᗩ𖣓ᙁⵙꗳ𖣓ᗱᗴᙁᑐᑕᴥⵙᑐᑕ𖣓ИNᗩⵙИNⓄᙁⓄߦᗩ𖣓ИNⓄⵙↀⵙᗯⵙↀ⚭ᑎᔓᔕ𖣓ⵙ✻ᔓᔕИNⵙߦᴥᗱᗴⵙᔓᔕ⚪𔗢⚪🞋⚪𔗢⚪ᔓᔕⵙᗱᗴᴥߦⵙИNᔓᔕ✻ⵙ𖣓ᔓᔕᑎ⚭ↀⵙᗯⵙↀⵙⓄИN𖣓ᗩߦⓄᙁⓄИNⵙᗩИN𖣓ᑐᑕⵙᴥᑐᑕᙁᗱᗴ𖣓ꗳⵙᙁ𖣓ᗩߦᴥⓄꕤⵙᙏᗩ✣ⵙⓄИN⚪𖣠.GHX (Grasshopper 1.0.7)
# plug-ins: HoopSnake, Anemone, BullAnt, GhPolyhedra, NGon, BubalusGH2.0, Weaverbird, Nautilus, CurvePlus, Pufferfish, MeshEdit Components

polyhedron = Polyhedron(Name="OCTAHEDRON", Plane=PlaneXY(0, 0, 0), Scale=1)  # -> Curves, Meshes, Solid; disabled
ngon_edges = NGonEdges()  # -> Edges, ID, NakedID, Normal, Naked, AllE; disabled
number_slider = Slider(2, range=0..10)  # disabled
polygon = Polygon(Plane=PlaneXY(0, 0, 0), Radius=1, Segments=3, FilletRadius=0)  # -> Polygon, Length; disabled
polar_zonohedron = PolarZonohedron(Plane=PlaneXY(0, 0, 0), Frequency=4, Pitch=0.6154797087, Length=1)  # -> Curves, Mesh; disabled
ggnetworkpolygons = GgNetworkPolygons(Curves=polyhedron.Curves, PerimOrVoid=4)  # -> flatten(Cells); disabled
brep_wireframe = BrepWireframe(Brep=polyhedron.Curves, Density=-1)  # disabled
digit_scroller = DigitScroller(Scroller_Digits=12, Scroller_Prefix="Digit Scroller", Scroller_Radix=11, Scroller_Value=2)  # disabled
polygon_2 = Polygon(Plane=PlaneXY(0, 0, 0), Radius=1, Segments=3, FilletRadius=0)  # -> Polygon, Length
button = Button()  # disabled
fast_loop_start = FastLoopStart(Iterations=2, Data=polygon.Polygon)  # -> port, Counter, Data; disabled
loop_start = LoopStart(Repeat=digit_scroller, Trigger=button, Data=polygon.Polygon)  # -> port, Counter, Data; disabled
polyhedron_2 = Polyhedron(Name="TRUNCATED RHOMBICUBOCTAHEDRON", Plane=PlaneXY(0, 0, 0), Scale=1)  # -> Curves, Meshes, Solid
quad_sphere = QuadSphere(Base=PlaneXY(0, 0, 0), Radius=6)
infoglasses = InfoGlasses(Run=True, Language=0)
explode = Explode(Curve=polygon_2.Polygon, Recursive=True)  # -> Segments, Vertices
area = Area(Geometry=polygon_2.Polygon)  # -> Area, Centroid
split_curves = SplitCurves(Curves=flatten(polygon_2.Polygon))  # -> flatten(Curves), Points
explode_2 = Explode(Curve=loop_start.Data, Recursive=True)  # -> Segments, Vertices; disabled
area_2 = Area(Geometry=loop_start.Data)  # -> Area, Centroid; disabled
list_item = ListItem(List=explode.Segments, Index=0, Wrap=True)  # -> Item, Item1, Item2
waterman = Waterman(Plane=PlaneXY(0, 0, 0), Root=19)  # -> Curves, Mesh
sphere = Sphere(Base=PlaneXY(0, 0, 0), Radius=1)
list_item_2 = ListItem(List=explode_2.Segments, Index=0, Wrap=True)  # -> flatten(Item); disabled
list_item_3 = ListItem(List=explode_2.Segments, Index=1, Wrap=True)  # -> flatten(Item); disabled
list_item_4 = ListItem(List=explode_2.Segments, Index=2, Wrap=True)  # -> flatten(Item); disabled
circle_tantantan = CircleTanTanTan(CurveA=list_item.Item, CurveB=list_item.Item1, CurveC=list_item.Item2, Point=area.Centroid)
power_of_2 = PowerOf2(Value="7")  # disabled
from_polylines = FromPolylines(Curves=waterman.Curves, Min_Triangulation=True)
weaverbird_s_sierpinski_triangles_subdiv = WeaverbirdsSierpinskiTrianglesSubdivision(MeshCurves=from_polylines, Level=4)
addngons = AddNGons(Mesh=weaverbird_s_sierpinski_triangles_subdiv, Pair=0)  # -> Polylines, Polylines_2, Mesh
laplacian_smoothing = LaplacianSmoothing(Mesh=addngons.Mesh, NakedEdges=False, Itterations=64)  # -> Mesh, Dispalcement
deconstruct_mesh = DeconstructMesh(Mesh=laplacian_smoothing.Mesh)  # -> Vertices, Faces, Colours, Normals; disabled
pull_point = PullPoint(Point=deconstruct_mesh.Vertices, Geometry=quad_sphere, ClosestOnly=True)  # -> ClosestPoint, Distance; disabled
construct_mesh = ConstructMesh(Vertices=pull_point.ClosestPoint, Faces=deconstruct_mesh.Faces, Colours=deconstruct_mesh.Colours)  # disabled
mesh_explode = MeshExplode(Mesh=laplacian_smoothing.Mesh, Interpolate=False)
mesh_edges = MeshEdges(Mesh=laplacian_smoothing.Mesh)  # -> AllE, NakedE
ggnetworkpolygons_2 = GgNetworkPolygons(Curves=mesh_edges.AllE, PerimOrVoid=65536)
degree_2_smooth = Degree2Smooth(Polyline=ggnetworkpolygons_2, Iterations=1)
curve_edit_points = CurveEditPoints(Curve=degree_2_smooth, Knots=True)  # -> Points, Tangents, Parameters
pull_point_2 = PullPoint(Point=curve_edit_points.Points, Geometry=from_polylines, ClosestOnly=True)  # -> ClosestPoint, Distance
polyline = PolyLine(Vertices=pull_point_2.ClosestPoint, Closed=True)
deconstruct_mesh_2 = DeconstructMesh(Mesh=mesh_explode)  # -> Vertices, Faces, Colours, Normals; disabled
polyline_2 = PolyLine(Vertices=deconstruct_mesh_2.Vertices, Closed=True)  # disabled
degree_2_smooth_2 = Degree2Smooth(Polyline=polyline_2, Iterations=2)  # disabled
from_polylines_2 = FromPolylines(Curves=degree_2_smooth_2, Min_Triangulation=True)  # disabled
deconstruct_mesh_3 = DeconstructMesh(Mesh=from_polylines_2)  # -> Vertices, Faces, Colours, Normals; disabled
pull_point_3 = PullPoint(Point=deconstruct_mesh_3.Vertices, Geometry=quad_sphere, ClosestOnly=True)  # -> ClosestPoint, Distance; disabled
construct_mesh_2 = ConstructMesh(Vertices=pull_point_3.ClosestPoint, Faces=deconstruct_mesh_3.Faces, Colours=deconstruct_mesh_3.Colours)  # disabled
merge = Merge(Data1=circle_tantantan, Data2=explode.Segments)
circle_tantantan_2 = CircleTanTanTan(CurveA=list_item_2, CurveB=list_item_3, CurveC=list_item_4, Point=area_2.Centroid)  # -> flatten(Circle); disabled
scale = Scale(Geometry=merge, Center=Point(0, 0, 0), Factor=expr("X*65536", 1))  # -> Geometry, Transform
divide_curves_on_intersects = DivideCurvesOnIntersects(Curves=scale.Geometry, Tolerance=7.629394531e-06)
scale_2 = Scale(Geometry=loop_start.Data, Center=Point(0, 0, 0), Factor=power_of_2)  # -> Geometry, Transform; disabled
scale_3 = Scale(Geometry=circle_tantantan_2, Center=Point(0, 0, 0), Factor=power_of_2)  # -> Geometry, Transform; disabled
scale_4 = Scale(Geometry=divide_curves_on_intersects, Center=Point(0, 0, 0), Factor=expr("X/65536", 1))  # -> Geometry, Transform
curve_middle = CurveMiddle(Curve=scale_4.Geometry)
vector_2pt = Vector2Pt(PointA=area.Centroid, PointB=curve_middle, Unitize=False)  # -> Vector, Length
region_difference = RegionDifference(CurvesA=scale_2.Geometry, CurvesB=scale_3.Geometry)  # disabled
hoopsnake = HoopSnake(
    StartingData=polygon.Polygon,
    Data=region_difference,
    TerminationCondition=number_slider,
    Hoopsnake_Data_autoUpdate=False,
    Hoopsnake_Data_dataLimit=2147483647,
    Hoopsnake_Data_delay=0,
    Hoopsnake_Data_resetCounter=True,
    Hoopsnake_Data_updateView=False)  # -> Feedback, CumulativeFeedback, LoopsCounter, IterationsCounter; disabled
angle = Angle(VectorA=Vector(0, 1, 0), VectorB=vector_2pt.Vector)  # -> Angle, Reflex
sort_list = SortList(Keys=angle.Angle, ValuesValuesA=scale_4.Geometry)  # -> Keys, ValuesValuesA
scale_5 = Scale(Geometry=region_difference, Center=Point(0, 0, 0), Factor=expr("1/X", power_of_2))  # -> Geometry, Transform; disabled
sift_pattern = SiftPattern(List=sort_list.ValuesValuesA, SiftPattern=[0, 1, 2])  # -> Output0, Output1, Output2
clean_tree = CleanTree(RemoveNulls=True, RemoveInvalid=True, RemoveEmpty=False, Tree=sift_pattern.Output2)
clean_tree_2 = CleanTree(RemoveNulls=True, RemoveInvalid=True, RemoveEmpty=False, Tree=sift_pattern.Output1)
clean_tree_3 = CleanTree(RemoveNulls=True, RemoveInvalid=True, RemoveEmpty=False, Tree=sift_pattern.Output0)
polyhedra_categories = PolyhedraCategories()
loop_end = LoopEnd(port=loop_start.port, Exit=False, Data=scale_5.Geometry, TimeOutVal=0, pausedState=False, state="Constant output")  # disabled
digit_scroller_2 = DigitScroller(Scroller_Digits=12, Scroller_Prefix="Digit Scroller", Scroller_Radix=11, Scroller_Value=149)
fast_loop_end = FastLoopEnd(port=fast_loop_start.port, Exit=False, Data=scale_5.Geometry, RecordData=True, TimeOutVal=0)  # disabled
curve_middle_2 = CurveMiddle(Curve=clean_tree_3)
list_item_5 = ListItem(List=polyhedra_categories, Index=0, Wrap=True)
polyhedra_names = PolyhedraNames(Category=list_item_5)
list_item_6 = ListItem(List=polyhedra_names, Index=digit_scroller_2, Wrap=True)
circle_tantantan_3 = CircleTanTanTan(CurveA=clean_tree_3, CurveB=clean_tree_2, CurveC=clean_tree, Point=curve_middle_2)
merge_2 = Merge(Data1=sort_list.ValuesValuesA, Data2=circle_tantantan_3)
