# Grasshopper definition HG.⠀⠀⠀⠀◯⠀ᙁᗩ✤ᑐᑕᗩᴥꗳ⠀◯⠀ИNⓄꖴᔓᔕꖴᗯꖴᗝ8ᑎᔓᔕ⠀◯⠀⠀⠀⠀ⵙ⠀⠀⠀⠀◯⠀ᔓᔕᑎ8ᗝꖴᗯꖴᔓᔕꖴⓄИN⠀◯⠀ꗳᴥᗩᑐᑕ✤ᗩᙁ⠀◯⠀⠀⠀⠀.GH (Grasshopper 1.0.7)
# plug-ins: Pancake

number_slider = Slider(0.5, range=0..1)
cir = Circle(Plane=PlaneXY(0, 0, 0), Radius=number_slider)
division = Division(A=1000000, B=9)
crv = Curve([<curve referenced from the Rhino model> x4])
division_2 = Division(A=number_slider, B=1.5)
neg = Negative(Value=division)
neg_2 = Negative(Value=division_2)
curvepoint = PointOnCurve(crv, parameter=0.25)
curvepoint_2 = PointOnCurve(crv, parameter=0.75)
offset = OffsetCurve(Curve=cir, Distance=neg_2, Corners=1)
offset_2 = OffsetCurve(Curve=crv, Distance=neg, Plane=PlaneXY(0, 0, 0), Corners=2)
number_slider_2 = Slider(10, range=0..11)
number_slider_3 = Slider(0.3, range=0..1)
divide = DivideCurve(Curve=offset, Count=4, Kinks=False)  # -> Points, Tangents, Parameters
divide_2 = DivideCurve(Curve=cir, Count=4, Kinks=False)  # -> Points, Tangents, Parameters
number_slider_4 = Slider(10, range=0..10)
number_slider_5 = Slider(4, range=0..10)
crv_2 = Curve(<curve referenced from the Rhino model>)
ln = Line(StartPoint=divide_2.Points, EndPoint=divide.Points)
join = JoinCurves(Curves=crv_2, Preserve=False)
xy = XYPlane(Origin=Point(0, 0, 0))
crv_3 = Curve([ln, offset, cir])
rotate = Rotate(Geometry=ln, Angle=0.7853981634, Plane=PlaneXY(0, 0, 0))  # -> Geometry, Transform
join_2 = JoinCurves(Curves=rotate.Geometry, Preserve=False)
pcexport3dm = Export3DM(
    Geometry=join_2,
    FileLocation="C:\O\O_AIDIW_O_WIDIA_O\O_SORECONIHR_O_RHINOCEROS_O\O_REPOHSARG_O_GRASHOPER_O\MDԐ.HG.⠀⠀⠀⠀◯⠀ᙁᗩ✤ᑐᑕᗩᴥꗳ⠀◯⠀ИNⓄꖴᔓᔕꖴᗯꖴᗝ8ᑎᔓᔕ⠀◯⠀⠀⠀⠀ⵙ⠀⠀⠀⠀◯⠀ᔓᔕᑎ8ᗝꖴᗯꖴᔓᔕꖴⓄИN⠀◯⠀ꗳᴥᗩᑐᑕ✤ᗩᙁ⠀◯⠀⠀⠀⠀.GH.3DM",
    Overwrite=True,
    Version=0,
    Export=True,
    LastSaveLocalization="neutral,N")  # -> OK, Log
radgrid = Radial(Plane=PlaneXY(0, 0, 0), Size=number_slider_3, ExtentR=number_slider_4, ExtentP=number_slider_5)  # -> Cells, Points
radialdia = RadialDiamond(P=xy, S=number_slider_3, Er=number_slider_4, Ep=number_slider_5)  # -> C, Pt; inputs P: Plane
# ---------- radialdia: VB ----------
    Component.Params.Input(0).Name = "Plane"
    Component.Params.Input(0).Description = "Base plane for grid"
    Component.Params.Input(1).Name = "Size"
    Component.Params.Input(1).Description = "Distance between concentric grid loops"
    Component.Params.Input(2).Name = "Extent R"
    Component.Params.Input(2).Description = "Number of grid cells in radial direction"
    Component.Params.Input(3).Name = "Extent P"
    Component.Params.Input(3).Description = "Number of grid cells in the polar direction"

    Component.Params.Output(0).Name = "Cells"
    Component.Params.Output(0).Description = "Grid cell outlines"
    Component.Params.Output(1).Name = "Points"
    Component.Params.Output(1).Description = "Points at grid nodes"

    Dim i,j,r As Integer
    Dim xV,yV As Integer
    Dim ptOut,ptGrid As New DataTree(Of Point3d)
    Dim crvOut As New datatree(Of Polyline)
    Dim pts As New list(Of Point3d)

    xV = (Er + 2)
    yV = Ep * 2

    For i = 0 To xV - 1 Step 1
      Dim ghPath As New gh_path(i)
      For j = 0 To yV Step 1

        ptGrid.Add(P.PointAt((i * S) * math.sin(math.PI * 2 * (j / yV)), (i * S) * math.cos(math.PI * 2 * (j / yV))), ghPath)
      Next
    Next

    r = 2
    For i = 0 To Er - 1 Step 1
      Dim ghPath As New gh_path(i)
      For j = 0 To Ep - 1 Step 1
        Dim ptList As New list(Of Point3d)
        If (i + 1) Mod 2 Then
          ptList.Add(ptGrid.branch(i).item(j * 2 + 1))
          ptList.Add(ptGrid.branch(i + 1).item(j * 2 + 2))
          ptList.Add(ptGrid.branch(i + 2).item(j * 2 + 1))
          ptList.Add(ptGrid.branch(i + 1).item(j * 2 + 0))
          ptList.Add(ptGrid.branch(i).item(j * 2 + 1))

          ptOut.add(ptGrid.branch(i + 2).item(j * 2 + 1), New gh_path(r))
          If i = 0 Then ptOut.add(ptGrid.branch(i).item(j * 2 + 1), New gh_path(r - 2))
        Else
          If j < Ep - 1 Then
            ptList.Add(ptGrid.branch(i).item(j * 2 + 2))
            ptList.Add(ptGrid.branch(i + 1).item(j * 2 + 3))
            ptList.Add(ptGrid.branch(i + 2).item(j * 2 + 2))
            ptList.Add(ptGrid.branch(i + 1).item(j * 2 + 1))
            ptList.Add(ptGrid.branch(i).item(j * 2 + 2))

            ptOut.add(ptGrid.branch(i + 2).item(j * 2 + 2), New gh_path(r))
            If i = 1 Then ptOut.add(ptGrid.branch(i).item(j * 2 + 2), New gh_path(r - 2))
          Else
            ptList.Add(ptGrid.branch(i).item(0))
            ptList.Add(ptGrid.branch(i + 1).item(1))
            ptList.Add(ptGrid.branch(i + 2).item(0))
            ptList.Add(ptGrid.branch(i + 1).item(j * 2 + 1))
            ptList.Add(ptGrid.branch(i).item(0))

            ptOut.add(ptGrid.branch(i + 2).item(0), New gh_path(r))
            If i = 1 Then ptOut.add(ptGrid.branch(i).item(0), New gh_path(r - 2))
          End If
        End If
        crvOut.add(New polyline(ptList), ghPath)
      Next
      r = r + 1
    Next

    C = crvOut
    Pt = ptOut
# ---------- end radialdia ----------
fillet = Fillet(Curve=radialdia.C, Radius=Slider(1, range=0..1))
