# Grasshopper definition XHꓨ.ᗺИ.⚪ИNⓄꖴ✤ᗩ✤ᑎߦᙏⓄᑐᑕ⚪ИNⓄꖴ✤ᑐᑕИNᑎꗳ⚪ᔓᔕᑎꖴ⚭ᗩꗳ⚪ꗳᗩ⚭ꖴᑎᔓᔕ⚪ꗳᑎИNᑐᑕ✤ꖴⓄИN⚪ᑐᑕⓄᙏߦᑎ✤ᗩ✤ꖴⓄИN⚪.NB.GHX (Grasshopper 1.0.7)

digit_scroller = DigitScroller(Scroller_Digits=12, Scroller_Prefix=" ", Scroller_Radix=11, Scroller_Value=4)
power_of_2 = PowerOf2(Value=digit_scroller)
panel = Panel("""0
1/4
2/4
3/4
4/4""")
range = Range(Domain=Domain(0, 1), Steps=power_of_2)
panel_2 = Panel("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")
panel_3 = Panel("(-16777216*(MAX(0,-255/256+X)^7-MAX(0,-253/256+X)^7-MAX(0,-251/256+X)^7+MAX(0,-249/256+X)^7-MAX(0,-247/256+X)^7+MAX(0,-245/256+X)^7+MAX(0,-243/256+X)^7-MAX(0,-241/256+X)^7-MAX(0,-239/256+X)^7+MAX(0,-237/256+X)^7+MAX(0,-235/256+X)^7-MAX(0,-233/256+X)^7+MAX(0,-231/256+X)^7-MAX(0,-229/256+X)^7-MAX(0,-227/256+X)^7+MAX(0,-225/256+X)^7-MAX(0,-223/256+X)^7+MAX(0,-221/256+X)^7+MAX(0,-219/256+X)^7-MAX(0,-217/256+X)^7+MAX(0,-215/256+X)^7-MAX(0,-213/256+X)^7-MAX(0,-211/256+X)^7+MAX(0,-209/256+X)^7+MAX(0,-207/256+X)^7-MAX(0,-205/256+X)^7-MAX(0,-203/256+X)^7+MAX(0,-201/256+X)^7-MAX(0,-199/256+X)^7+MAX(0,-197/256+X)^7+MAX(0,-195/256+X)^7-MAX(0,-193/256+X)^7-MAX(0,-191/256+X)^7+MAX(0,-189/256+X)^7+MAX(0,-187/256+X)^7-MAX(0,-185/256+X)^7+MAX(0,-183/256+X)^7-MAX(0,-181/256+X)^7-MAX(0,-179/256+X)^7+MAX(0,-177/256+X)^7+MAX(0,-175/256+X)^7-MAX(0,-173/256+X)^7-MAX(0,-171/256+X)^7+MAX(0,-169/256+X)^7-MAX(0,-167/256+X)^7+MAX(0,-165/256+X)^7+MAX(0,-163/256+X)^7-MAX(0,-161/256+X)^7+MAX(0,-159/256+X)^7-MAX(0,-157/256+X)^7-MAX(0,-155/256+X)^7+MAX(0,-153/256+X)^7-MAX(0,-151/256+X)^7+MAX(0,-149/256+X)^7+MAX(0,-147/256+X)^7-MAX(0,-145/256+X)^7-MAX(0,-143/256+X)^7+MAX(0,-141/256+X)^7+MAX(0,-139/256+X)^7-MAX(0,-137/256+X)^7+MAX(0,-135/256+X)^7-MAX(0,-133/256+X)^7-MAX(0,-131/256+X)^7+MAX(0,-129/256+X)^7-MAX(0,-127/256+X)^7+MAX(0,-125/256+X)^7+MAX(0,-123/256+X)^7-MAX(0,-121/256+X)^7+MAX(0,-119/256+X)^7-MAX(0,-117/256+X)^7-MAX(0,-115/256+X)^7+MAX(0,-113/256+X)^7+MAX(0,-111/256+X)^7-MAX(0,-109/256+X)^7-MAX(0,-107/256+X)^7+MAX(0,-105/256+X)^7-MAX(0,-103/256+X)^7+MAX(0,-101/256+X)^7+MAX(0,-99/256+X)^7-MAX(0,-97/256+X)^7+MAX(0,-95/256+X)^7-MAX(0,-93/256+X)^7-MAX(0,-91/256+X)^7+MAX(0,-89/256+X)^7-MAX(0,-87/256+X)^7+MAX(0,-85/256+X)^7+MAX(0,-83/256+X)^7-MAX(0,-81/256+X)^7-MAX(0,-79/256+X)^7+MAX(0,-77/256+X)^7+MAX(0,-75/256+X)^7-MAX(0,-73/256+X)^7+MAX(0,-71/256+X)^7-MAX(0,-69/256+X)^7-MAX(0,-67/256+X)^7+MAX(0,-65/256+X)^7+MAX(0,-63/256+X)^7-MAX(0,-61/256+X)^7-MAX(0,-59/256+X)^7+MAX(0,-57/256+X)^7-MAX(0,-55/256+X)^7+MAX(0,-53/256+X)^7+MAX(0,-51/256+X)^7-MAX(0,-49/256+X)^7-MAX(0,-47/256+X)^7+MAX(0,-45/256+X)^7+MAX(0,-43/256+X)^7-MAX(0,-41/256+X)^7+MAX(0,-39/256+X)^7-MAX(0,-37/256+X)^7-MAX(0,-35/256+X)^7+MAX(0,-33/256+X)^7-MAX(0,-31/256+X)^7+MAX(0,-29/256+X)^7+MAX(0,-27/256+X)^7-MAX(0,-25/256+X)^7+MAX(0,-23/256+X)^7-MAX(0,-21/256+X)^7-MAX(0,-19/256+X)^7+MAX(0,-17/256+X)^7+MAX(0,-15/256+X)^7-MAX(0,-13/256+X)^7-MAX(0,-11/256+X)^7+MAX(0,-9/256+X)^7-MAX(0,-7/256+X)^7+MAX(0,-5/256+X)^7+MAX(0,-3/256+X)^7-MAX(0,-1/256+X)^7))/315")
evaluate = Evaluate(Expression=panel_3, X=panel)
evaluate_2 = Evaluate(Expression=panel_3, X=range)
format = Format(Format="{0:R}", Culture=127, Data0=evaluate)
panel_4 = Panel(format)
construct_point = ConstructPoint(XCoordinate=range, YCoordinate=evaluate_2, ZCoordinate=0)
