# Grasshopper definition XHG.⠀⠀⠀⠀ⵙᗱᗴⵙᴥⵙᑎⵙ✤ⵙᗩⵙᗯⵙᴥⵙᑎⵙᑐᑕⵙ◯ⵙᗝⵙᗱᗴⵙߦⵙᗩⵙᙏⵙ◯ⵙᗝⵙꖴⵙⓄⵙᙏⵙᕤᕦⵙꖴⵙᔓᔕⵙ◯ⵙᗱᗴⵙᴥⵙᑎⵙ✤ⵙᗩⵙᗯⵙᴥⵙᑎⵙᑐᑕⵙ◯ⵙᴥⵙᗩⵙᗱᗴⵙИNⵙꖴⵙᙁⵙ⠀⠀⠀⠀◯⠀⠀⠀⠀ⵙ⠀⠀⠀⠀◯⠀⠀⠀⠀ⵙᙁⵙꖴⵙИNⵙᗱᗴⵙᗩⵙᴥⵙ◯ⵙᑐᑕⵙᑎⵙᴥⵙᗯⵙᗩⵙ✤ⵙᑎⵙᴥⵙᗱᗴⵙ◯ⵙᔓᔕⵙꖴⵙᕤᕦⵙᙏⵙⓄⵙꖴⵙᗝⵙ◯ⵙᙏⵙᗩⵙߦⵙᗱᗴⵙᗝⵙ◯ⵙᑐᑕⵙᑎⵙᴥⵙᗯⵙᗩⵙ✤ⵙᑎⵙᴥⵙᗱᗴⵙ⠀⠀⠀⠀.GHX (Grasshopper 1.0.7)
# plug-ins: Pufferfish

division = Division(A=0.008191091953, B=0.002047674723)
ma = MassAddition()  # -> Result, PartialResults
digit_scroller = DigitScroller(Scroller_Digits=12, Scroller_Prefix="Digit Scroller", Scroller_Radix=11, Scroller_Value=96)
number_slider = Slider(31, range=0..100)
number_slider_2 = Slider(32, range=0..100)
digit_scroller_2 = DigitScroller(Scroller_Digits=12, Scroller_Prefix="Digit Scroller", Scroller_Radix=11, Scroller_Value=64)
digit_scroller_3 = DigitScroller(Scroller_Digits=12, Scroller_Prefix="Digit Scroller", Scroller_Radix=11, Scroller_Value=93)
xz_plane = XZPlane(Origin=Point(0, 0, 0))
panel = Panel("""16                0.49642790190
32                0.122908661045
64                0.030606376078
128              0.0076380878337
256              0.001908488092445""")
division_2 = Division(A=0.4964279019, B=0.122908661)
digit_scroller_4 = DigitScroller(Scroller_Digits=12, Scroller_Prefix="Digit Scroller", Scroller_Radix=1, Scroller_Value=4.411602319)
curve = Curve()
number = Number(Slider(256, range=0..1024))
digit_scroller_5 = DigitScroller(Scroller_Digits=12, Scroller_Prefix="Digit Scroller", Scroller_Radix=11, Scroller_Value=88)
panel_2 = Panel("0.496323571135")
panel_3 = Panel("0.52916013400")
xz_plane_2 = XZPlane(Origin=Point(0, 0, 0))

digit_scroller_6 = DigitScroller(Scroller_Digits=12, Scroller_Prefix="Digit Scroller", Scroller_Radix=1, Scroller_Value=0.00204767472)
number_slider_3 = Slider(1, range=0..1)
panel_5 = Panel("""16                0.526707628425
32                0.131193530865
64                0.03277086292
128              0.00819109195275
256              0.00204767472315""")
number_slider_4 = Slider(256, range=0..256)
one_over_x = OneOverX(Value=number_slider_4)
radians = Radians(Degrees="0.00204767472315")
dup = DuplicateData(Data=one_over_x, Number=number_slider_4, Order=True)
division_3 = Division(A=0.5267076284, B=0.1311935309)
series = Series(Start=0, Step=radians, Count=number_slider_4)
turtle = DotNETVBScriptLEGACY(Forward=dup, Left=series)  # -> out, Points; inputs Forward: list, Left: list
# ---------- turtle: VB ----------
    Dim i As Integer
    Dim dir As New On3dVector(1, 0, 0)    
    Dim pos As New On3dVector(0, 0, 0) 
    Dim axis As New On3dVector(0, 0, 1)
    Dim pnts As New List(Of On3dVector)

    pnts.Add(pos)
    
    For i = 0 To Forward.Count() - 1
      Dim P As New On3dVector
      dir.Rotate(Left(i), axis)      
      P = dir * Forward(i) + pnts(i)
      pnts.Add(P)
    Next
    
    Points = pnts
# ---------- end turtle ----------
panel_6 = Panel("""16    0.52916013400
32    0.13119985428""")
panel_7 = Panel("""16    0.35233813056
32    0.08793657256""")
point = Point(turtle.Points)
interpolate = Interpolate(Vertices=turtle.Points, Degree=3, Periodic=False, KnotStyle=0)  # -> Curve, Length, Domain

evaluate_length = EvaluateLength(Curve=interpolate.Curve, Length=1, Normalized=True)  # -> Point, Tangent, Parameter
line_sdl = LineSDL(Start=evaluate_length.Point, Direction=evaluate_length.Tangent, Length=1)
mirror = Mirror(Geometry=interpolate.Curve, Plane=line_sdl)  # -> Geometry, Transform
join_curves = JoinCurves(Curves=[interpolate.Curve, mirror.Geometry], Preserve=False)

number_2 = Number(number_slider_4)
curve_2 = Curve(join_curves)
divide_curve = DivideCurve(Curve=curve_2, Count=number_2, Kinks=False)  # -> Points, Tangents, Parameters
curvature = Curvature(Curve=curve_2, Parameter=divide_curve.Parameters)  # -> Point, Curvature, Curvature_2
deconstruct_arc = DeconstructArc(Arc=curvature.Curvature_2)  # -> BasePlane, Radius, Angle
one_over_x_2 = OneOverX(Value=deconstruct_arc.Radius)
quick_graph = QuickGraph(one_over_x_2, SortOrder=0)

curvature_graph = CurvatureGraph(Curve=curve_2, Density=1, Scale=digit_scroller)
series_2 = Series(Start=0, Step=one_over_x, Count=number_2)
construct_point = ConstructPoint(XCoordinate=series_2, YCoordinate=one_over_x_2, ZCoordinate=0)
polyline = PolyLine(Vertices=construct_point, Closed=False)
quick_graph_2 = QuickGraph(one_over_x_2, SortOrder=0)
explode = Explode(Curve=polyline, Recursive=True)  # -> Segments, Vertices
end_points = EndPoints(Curve=join_curves)  # -> Start, End
list_length = ListLength(List=explode.Segments)  # -> expr("X/2", Length)
line = Line(StartPoint=end_points.Start, EndPoint=end_points.End)
evaluate_length_2 = EvaluateLength(Curve=join_curves, Length=1, Normalized=True)  # -> Point, Tangent, Parameter
list_item = ListItem(List=explode.Segments, Index=expr("X-1", list_length), Wrap=False)
list_item_2 = ListItem(List=explode.Segments, Index=list_length, Wrap=False)
curve_middle = CurveMiddle(Curve=join_curves)
angle = Angle(VectorA=Vector(21.5, 0, 0), VectorB=evaluate_length_2.Tangent)  # -> Angle, Reflex
angle_2 = Angle(VectorA=list_item_2, VectorB=list_item)  # -> Angle, Reflex
expression = Expression(x=angle_2.Angle, Expression="Format(\"{0:R}\", x)")
degrees = Degrees(Radians=angle_2.Angle)
evaluate_length_3 = EvaluateLength(Curve=mirror.Geometry, Length=0, Normalized=True)  # -> Point, Tangent, Parameter
angle_3 = Angle(VectorA=Vector(1.4375, 0, 0), VectorB=line)  # -> Angle, Reflex
panel_8 = Panel(degrees)
rotate = Rotate(Geometry=join_curves, Angle=expr("-X", angle_3.Angle), Plane=curve_middle)  # -> Geometry, Transform
vector_2pt = Vector2Pt(PointA=curve_middle, PointB=Point(0, 0, 0), Unitize=False)  # -> Vector, Length
rotate_2 = Rotate(Geometry=mirror.Geometry, Angle=3.141592654, Plane=evaluate_length_3.Point)  # -> Geometry, Transform
move = Move(Geometry=rotate.Geometry, Motion=vector_2pt.Vector)  # -> Geometry, Transform
curve_domain = CurveDomain(Curve=move.Geometry)  # -> Curve, Domain
deconstruct_domain = DeconstructDomain(Domain=curve_domain.Domain)  # -> Start, End
construct_domain = ConstructDomain(DomainStart=deconstruct_domain.End, DomainEnd=expr("X/2", deconstruct_domain.End))
sub_curve = SubCurve(BaseCurve=curve_domain.Curve, Domain=construct_domain)
evaluate_length_4 = EvaluateLength(Curve=sub_curve, Length=1, Normalized=True)  # -> Point, Tangent, Parameter
rotate_3 = Rotate(Geometry=sub_curve, Angle=3.141592654, Plane=evaluate_length_4.Point)  # -> Geometry, Transform
join_curves_2 = JoinCurves(Curves=[sub_curve, rotate_3.Geometry], Preserve=False)
rotate_4 = Rotate(Geometry=join_curves, Angle=expr("-X", angle_3.Angle), Plane=curve_middle)  # -> Geometry, Transform
bounding_box = BoundingBox(Content=join_curves_2, Plane=PlaneXY(0, 0, 0), UnionBox=True)  # -> Box, Box_2
deconstruct_box = DeconstructBox(Box=bounding_box.Box)  # -> Plane, X, Y, Z
deconstruct_domain_2 = DeconstructDomain(Domain=deconstruct_box.X)  # -> Start, End
deconstruct_domain_3 = DeconstructDomain(Domain=deconstruct_box.Y)  # -> Start, End
scale = Scale(Geometry=join_curves_2, Center=Point(0, 0, 0), Factor=expr("1/X", deconstruct_domain_2.End))  # -> Geometry, Transform
division_4 = Division(A=deconstruct_domain_2.End, B=deconstruct_domain_3.End)

panel_9 = Panel(division_4)
degrees_2 = Degrees(Radians=angle.Angle)
panel_10 = Panel(degrees_2)

curve_3 = Curve(scale.Geometry)

number_3 = Number(number_slider_4)
curve_4 = Curve(curve_3)
divide_curve_2 = DivideCurve(Curve=curve_4, Count=number_3, Kinks=False)  # -> Points, Tangents, Parameters
curvature_2 = Curvature(Curve=curve_4, Parameter=divide_curve_2.Parameters)  # -> Point, Curvature, Curvature_2
deconstruct_arc_2 = DeconstructArc(Arc=curvature_2.Curvature_2)  # -> BasePlane, Radius, Angle
one_over_x_3 = OneOverX(Value=deconstruct_arc_2.Radius)
quick_graph_3 = QuickGraph(one_over_x_3, SortOrder=0)

digit_scroller_7 = DigitScroller(Scroller_Digits=12, Scroller_Prefix="Digit Scroller", Scroller_Radix=11, Scroller_Value=94)
curvature_graph_2 = CurvatureGraph(Curve=curve_4, Density=1, Scale=digit_scroller_7)
series_3 = Series(Start=0, Step=one_over_x, Count=number_3)
construct_point_2 = ConstructPoint(XCoordinate=series_3, YCoordinate=one_over_x_3, ZCoordinate=0)
polyline_2 = PolyLine(Vertices=construct_point_2, Closed=False)
quick_graph_4 = QuickGraph(one_over_x_3, SortOrder=0)
number_slider_5 = Slider(31, range=0..100)
number_slider_6 = Slider(32, range=0..100)
explode_2 = Explode(Curve=polyline_2, Recursive=True)  # -> Segments, Vertices
list_length_2 = ListLength(List=explode_2.Segments)  # -> expr("X/4", Length)
digit_scroller_8 = DigitScroller(Scroller_Digits=12, Scroller_Prefix="Digit Scroller", Scroller_Radix=11, Scroller_Value=64)
list_item_3 = ListItem(List=explode_2.Segments, Index=expr("X+(X/2)", list_length_2), Wrap=False)
list_item_4 = ListItem(List=explode_2.Segments, Index=expr("X-(X/2)", list_length_2), Wrap=False)
angle_4 = Angle(VectorA=list_item_3, VectorB=list_item_4)  # -> Angle, Reflex
expression_2 = Expression(x=angle_4.Angle, Expression="Format(\"{0:R}\", x)")
degrees_3 = Degrees(Radians=angle_4.Angle)
panel_11 = Panel(degrees_3)

number_4 = Number(number_slider_4)
curve_5 = Curve(curve_3)
divide_curve_3 = DivideCurve(Curve=curve_5, Count=number_4, Kinks=False)  # -> Points, Tangents, Parameters
curvature_3 = Curvature(Curve=curve_5, Parameter=divide_curve_3.Parameters)  # -> Point, Curvature, Curvature_2
deconstruct_arc_3 = DeconstructArc(Arc=curvature_3.Curvature_2)  # -> BasePlane, Radius, Angle
one_over_x_4 = OneOverX(Value=deconstruct_arc_3.Radius)
quick_graph_5 = QuickGraph(one_over_x_4, SortOrder=0)

relative_differences = RelativeDifferences(Values=one_over_x_4)
panel_12 = Panel(relative_differences)
quick_graph_6 = QuickGraph(panel_12, SortOrder=0)

relative_differences_2 = RelativeDifferences(Values=relative_differences)
panel_13 = Panel(relative_differences_2)
quick_graph_7 = QuickGraph(panel_13, SortOrder=0)

relative_differences_3 = RelativeDifferences(Values=relative_differences_2)
panel_14 = Panel(relative_differences_3)
quick_graph_8 = QuickGraph(panel_14, SortOrder=0)

digit_scroller_9 = DigitScroller(Scroller_Digits=12, Scroller_Prefix="Digit Scroller", Scroller_Radix=11, Scroller_Value=93)
curvature_graph_3 = CurvatureGraph(Curve=curve_5, Density=1, Scale=digit_scroller_9)
series_4 = Series(Start=0, Step=expr("1/X", number_4), Count=number_4)
construct_point_3 = ConstructPoint(XCoordinate=series_4, YCoordinate=expr("X/2", one_over_x_4), ZCoordinate=0)
polyline_3 = PolyLine(Vertices=construct_point_3, Closed=False)
quick_graph_9 = QuickGraph(one_over_x_4, SortOrder=0)
number_slider_7 = Slider(31, range=0..100)
number_slider_8 = Slider(32, range=0..100)
explode_3 = Explode(Curve=polyline_3, Recursive=True)  # -> Segments, Vertices
list_length_3 = ListLength(List=explode_3.Segments)  # -> expr("X/4", Length)
digit_scroller_10 = DigitScroller(Scroller_Digits=12, Scroller_Prefix="Digit Scroller", Scroller_Radix=11, Scroller_Value=64)
list_item_5 = ListItem(List=explode_3.Segments, Index=expr("X+(X/2)", list_length_3), Wrap=False)
list_item_6 = ListItem(List=explode_3.Segments, Index=expr("X-(X/2)", list_length_3), Wrap=False)
angle_5 = Angle(VectorA=list_item_5, VectorB=list_item_6)  # -> Angle, Reflex
expression_3 = Expression(X=angle_5.Angle, Expression="Format(\"{0:R}\", x)")
degrees_4 = Degrees(Radians=angle_5.Angle)
panel_15 = Panel(degrees_4)

interpolate_2 = Interpolate(Vertices=construct_point_3, Degree=3, Periodic=False, KnotStyle=1)  # -> Curve, Length, Domain
curvature_graph_4 = CurvatureGraph(Curve=interpolate_2.Curve, Density=1, Scale=digit_scroller_3)
bounding_box_2 = BoundingBox(Content=interpolate_2.Curve, Plane=PlaneXY(0, 0, 0))  # -> Box, Box_2
deconstruct_box_2 = DeconstructBox(Box=bounding_box_2.Box)  # -> Plane, X, Y, Z
bounding_box_3 = BoundingBox(Content=curve_3, Plane=PlaneXY(0, 0, 0), UnionBox=True)  # -> Box, Box_2
deconstruct_domain_4 = DeconstructDomain(Domain=deconstruct_box_2.X)  # -> Start, End
deconstruct_domain_5 = DeconstructDomain(Domain=deconstruct_box_2.Y)  # -> Start, End
deconstruct_box_3 = DeconstructBox(Box=bounding_box_3.Box)  # -> Plane, X, Y, Z
scale_nu = ScaleNU(
    Geometry=interpolate_2.Curve,
    Plane=PlaneXY(0, 0, 0),
    ScaleX=expr("1/X", deconstruct_domain_4.End),
    ScaleY=expr(".5/X", deconstruct_domain_5.End),
    ScaleZ=1)  # -> Geometry, Transform
rectangle = Rectangle(Plane=PlaneXY(0, 0, 0), XSize=deconstruct_box_3.X, YSize=deconstruct_box_3.Y, Radius=0)  # -> Rectangle, Length
move_2 = Move(Geometry=scale_nu.Geometry, Motion=Vector(0, -1, 0))  # -> Geometry, Transform
curve_6 = Curve(curve_5)
curve_7 = Curve(move_2.Geometry)
evaluate_length_5 = EvaluateLength(Curve=curve_3, Length=1, Normalized=True)  # -> Point, Tangent, Parameter

deconstruct = Deconstruct(Point=evaluate_length_5.Point)  # -> XComponent, YComponent, ZComponent
construct_point_4 = ConstructPoint(XCoordinate=0, YCoordinate=deconstruct.YComponent, ZCoordinate=0)
vector_2pt_2 = Vector2Pt(PointA=construct_point_4, PointB=evaluate_length_5.Point, Unitize=False)  # -> Vector, Length

yz_plane = YZPlane(Origin=evaluate_length_5.Point)
mirror_2 = Mirror(Geometry=curve_3, Plane=yz_plane)  # -> Geometry, Transform
join_curves_3 = JoinCurves(Curves=[curve_3, mirror_2.Geometry], Preserve=False)
scale_nu_2 = ScaleNU(Geometry=join_curves_3, Plane=PlaneXY(0, 0, 0), ScaleX=0.5, ScaleY=expr("-X", 0.5), ScaleZ=1)  # -> Geometry, Transform
move_3 = Move(Geometry=scale_nu_2.Geometry, Motion=Vector(1, -0.5, 0))  # -> Geometry, Transform
curve_8 = Curve(move_3.Geometry)

number_slider_9 = Slider(40, range=0..256)
curve_9 = Curve(curve_8)
number_5 = Number(number)
divide_curve_4 = DivideCurve(Curve=curve_9, Count=number_5, Kinks=False)  # -> Points, Tangents, Parameters
curvature_4 = Curvature(Curve=curve_9, Parameter=divide_curve_4.Parameters)  # -> Point, Curvature, Curvature_2
deconstruct_arc_4 = DeconstructArc(Arc=curvature_4.Curvature_2)  # -> BasePlane, Radius, Angle
one_over_x_5 = OneOverX(Value=deconstruct_arc_4.Radius)
panel_16 = Panel(one_over_x_5)
quick_graph_10 = QuickGraph(one_over_x_5, SortOrder=0)
line_2 = Line(StartPoint=curvature_4.Point, EndPoint=deconstruct_arc_4.BasePlane)
multiplication = Multiplication(A=one_over_x_5, B=Slider(0.015666, range=0..0.5))
line_sdl_2 = LineSDL(Start=curvature_4.Point, Direction=line_2, Length=expr("-ABS(X)", multiplication))
evaluate_length_6 = EvaluateLength(Curve=line_sdl_2, Length=1, Normalized=True)  # -> Point, Tangent, Parameter
interpolate_3 = Interpolate(Vertices=evaluate_length_6.Point, Degree=3, Periodic=False, KnotStyle=2)  # -> Curve, Length, Domain

nurbs_curve = NurbsCurve(Vertices=evaluate_length_6.Point, Degree=11, Periodic=False)  # -> Curve, Length, Domain
bounding_box_4 = BoundingBox(Content=interpolate_3.Curve, Plane=PlaneXY(0, 0, 0), UnionBox=True)  # -> Box, Box_2
deconstruct_box_4 = DeconstructBox(Box=bounding_box_4.Box)  # -> Plane, X, Y, Z
deconstruct_domain_6 = DeconstructDomain(Domain=deconstruct_box_4.Y)  # -> Start, End
relative_differences_4 = RelativeDifferences(Values=[deconstruct_domain_6.Start, deconstruct_domain_6.End])
list_item_7 = ListItem(List=relative_differences_4, Index=1, Wrap=False)
panel_17 = Panel(list_item_7)
curvature_graph_5 = CurvatureGraph(Curve=move_3.Geometry, Density=1, Scale=digit_scroller_5)

digit_scroller_11 = DigitScroller(Scroller_Digits=12, Scroller_Prefix="Digit Scroller", Scroller_Radix=1, Scroller_Value=0.9905597227)
number_slider_10 = Slider(29, range=0..256)
number_6 = Number(number)
curve_10 = Curve(curve_8)
divide_curve_5 = DivideCurve(Curve=curve_10, Count=number_6, Kinks=False)  # -> Points, Tangents, Parameters
curvature_5 = Curvature(Curve=curve_10, Parameter=divide_curve_5.Parameters)  # -> Point, Curvature, Curvature_2
deconstruct_arc_5 = DeconstructArc(Arc=curvature_5.Curvature_2)  # -> BasePlane, Radius, Angle
line_3 = Line(StartPoint=curvature_5.Point, EndPoint=deconstruct_arc_5.BasePlane)
one_over_x_6 = OneOverX(Value=deconstruct_arc_5.Radius)
relative_differences_5 = RelativeDifferences(Values=one_over_x_6)
quick_graph_11 = QuickGraph(relative_differences_5, SortOrder=0)
multiplication_2 = Multiplication(A=relative_differences_5, B=digit_scroller_11)
panel_18 = Panel(relative_differences_5)

point_2 = Point(curvature_5.Point)

line_sdl_3 = LineSDL(Start=point_2, Direction=line_3, Length=expr("-ABS(X)", multiplication_2))
evaluate_length_7 = EvaluateLength(Curve=line_sdl_3, Length=1, Normalized=True)  # -> Point, Tangent, Parameter
interpolate_4 = Interpolate(Vertices=evaluate_length_7.Point, Degree=3, Periodic=False, KnotStyle=2)  # -> Curve, Length, Domain

nurbs_curve_2 = NurbsCurve(Vertices=evaluate_length_7.Point, Degree=11, Periodic=False)  # -> Curve, Length, Domain
mirror_3 = Mirror(Geometry=[line_sdl_3, interpolate_4.Curve], Plane=xz_plane)  # -> Geometry, Transform
move_4 = Move(Geometry=mirror_3.Geometry, Motion=Vector(0, -2.5, 0))  # -> Geometry, Transform
bounding_box_5 = BoundingBox(Content=move_4.Geometry, Plane=PlaneXY(0, 0, 0), UnionBox=True)  # -> Box, Box_2
deconstruct_box_5 = DeconstructBox(Box=bounding_box_5.Box)  # -> Plane, X, Y, Z
deconstruct_domain_7 = DeconstructDomain(Domain=deconstruct_box_5.Y)  # -> Start, End
relative_differences_6 = RelativeDifferences(Values=[deconstruct_domain_7.Start, deconstruct_domain_7.End])
list_item_8 = ListItem(List=relative_differences_6, Index=1, Wrap=False)
panel_19 = Panel(list_item_8)
division_5 = Division(A=panel_19, B=panel_17)
panel_20 = Panel(division_5)

digit_scroller_12 = DigitScroller(Scroller_Digits=12, Scroller_Prefix="Digit Scroller", Scroller_Radix=1, Scroller_Value=0.00190848809)
radians_2 = Radians(Degrees="0.001908488092445")
series_5 = Series(Start=0, Step=radians_2, Count=number_slider_4)

curve_graph_mapper = CurveGraphMapper(Curves=curve_3, Rectangle=rectangle.Rectangle, Values=series_5, Flip=False, Snap=False, TextSize=1)  # -> Mapped, GraphCurves, GraphPoints, ValueLines, ValuePoints, MappedLines, MappedPoints, Boundary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

turtle_2 = DotNETVBScriptLEGACY(Forward=dup, Left=curve_graph_mapper.Mapped)  # -> out, Points; inputs Forward: list, Left: list; same code as turtle
point_3 = Point(turtle_2.Points)
interpolate_5 = Interpolate(Vertices=turtle_2.Points, Degree=3, Periodic=False, KnotStyle=0)  # -> Curve, Length, Domain

evaluate_length_8 = EvaluateLength(Curve=interpolate_5.Curve, Length=1, Normalized=True)  # -> Point, Tangent, Parameter
line_sdl_4 = LineSDL(Start=evaluate_length_8.Point, Direction=evaluate_length_8.Tangent, Length=1)
mirror_4 = Mirror(Geometry=interpolate_5.Curve, Plane=line_sdl_4)  # -> Geometry, Transform
join_curves_4 = JoinCurves(Curves=[interpolate_5.Curve, mirror_4.Geometry], Preserve=False)
end_points_2 = EndPoints(Curve=join_curves_4)  # -> Start, End
line_4 = Line(StartPoint=end_points_2.Start, EndPoint=end_points_2.End)
angle_6 = Angle(VectorA=Vector(1.4375, 0, 0), VectorB=line_4)  # -> Angle, Reflex
rotate_5 = Rotate(Geometry=join_curves_4, Angle=expr("-X", angle_6.Angle), Plane=evaluate_length_8.Point)  # -> Geometry, Transform
vector_2pt_3 = Vector2Pt(PointA=evaluate_length_8.Point, PointB=Point(0, 0, 0), Unitize=False)  # -> Vector, Length
move_5 = Move(Geometry=rotate_5.Geometry, Motion=vector_2pt_3.Vector)  # -> Geometry, Transform
curve_domain_2 = CurveDomain(Curve=move_5.Geometry)  # -> Curve, Domain
deconstruct_domain_8 = DeconstructDomain(Domain=curve_domain_2.Domain)  # -> Start, End
construct_domain_2 = ConstructDomain(DomainStart=expr("X/2", deconstruct_domain_8.End), DomainEnd=deconstruct_domain_8.End)
sub_curve_2 = SubCurve(BaseCurve=curve_domain_2.Curve, Domain=construct_domain_2)
evaluate_length_9 = EvaluateLength(Curve=sub_curve_2, Length=1, Normalized=True)  # -> Point, Tangent, Parameter
rotate_6 = Rotate(Geometry=sub_curve_2, Angle=3.141592654, Plane=evaluate_length_9.Point)  # -> Geometry, Transform
join_curves_5 = JoinCurves(Curves=[sub_curve_2, rotate_6.Geometry], Preserve=False)
bounding_box_6 = BoundingBox(Content=join_curves_5, Plane=PlaneXY(0, 0, 0), UnionBox=True)  # -> Box, Box_2
deconstruct_box_6 = DeconstructBox(Box=bounding_box_6.Box)  # -> Plane, X, Y, Z
scale_2 = Scale(Geometry=join_curves_5, Center=Point(0, 0, 0), Factor=expr("X^-1", deconstruct_box_6.X))  # -> Geometry, Transform
mirror_5 = Mirror(Geometry=scale_2.Geometry, Plane=yz_plane)  # -> Geometry, Transform
deconstruct_domain_9 = DeconstructDomain(Domain=deconstruct_box_6.X)  # -> Start, End
deconstruct_domain_10 = DeconstructDomain(Domain=deconstruct_box_6.Y)  # -> Start, End
curve_11 = Curve(mirror_5.Geometry)

number_7 = Number(number_slider_4)
curve_12 = Curve(curve_11)
divide_curve_6 = DivideCurve(Curve=curve_12, Count=number_7, Kinks=False)  # -> Points, Tangents, Parameters
curvature_6 = Curvature(Curve=curve_12, Parameter=divide_curve_6.Parameters)  # -> Point, Curvature, Curvature_2
deconstruct_arc_6 = DeconstructArc(Arc=curvature_6.Curvature_2)  # -> BasePlane, Radius, Angle
one_over_x_7 = OneOverX(Value=deconstruct_arc_6.Radius)
quick_graph_12 = QuickGraph(one_over_x_7, SortOrder=0)

relative_differences_7 = RelativeDifferences(Values=one_over_x_7)
panel_21 = Panel(relative_differences_7)
quick_graph_13 = QuickGraph(panel_21, SortOrder=0)

relative_differences_8 = RelativeDifferences(Values=relative_differences_7)
panel_22 = Panel(relative_differences_8)
quick_graph_14 = QuickGraph(panel_22, SortOrder=0)

relative_differences_9 = RelativeDifferences(Values=relative_differences_8)
panel_23 = Panel(relative_differences_9)
quick_graph_15 = QuickGraph(panel_23, SortOrder=0)

curve_13 = Curve(curve_12)

number_slider_11 = Slider(40, range=0..256)
curve_14 = Curve([curve_6, curve_13])
number_8 = Number(number)
divide_curve_7 = DivideCurve(Curve=curve_14, Count=number_8, Kinks=False)  # -> Points, Tangents, Parameters
curvature_7 = Curvature(Curve=curve_14, Parameter=divide_curve_7.Parameters)  # -> Point, Curvature, Curvature_2
deconstruct_arc_7 = DeconstructArc(Arc=curvature_7.Curvature_2)  # -> BasePlane, Radius, Angle
one_over_x_8 = OneOverX(Value=deconstruct_arc_7.Radius)
panel_24 = Panel(one_over_x_8)
quick_graph_16 = QuickGraph(one_over_x_8, SortOrder=0)
line_5 = Line(StartPoint=curvature_7.Point, EndPoint=deconstruct_arc_7.BasePlane)
multiplication_3 = Multiplication(A=one_over_x_8, B=Slider(0.088888, range=0..0.5))
line_sdl_5 = LineSDL(Start=curvature_7.Point, Direction=line_5, Length=expr("-ABS(X)", multiplication_3))
evaluate_length_10 = EvaluateLength(Curve=line_sdl_5, Length=1, Normalized=True)  # -> Point, Tangent, Parameter
interpolate_6 = Interpolate(Vertices=evaluate_length_10.Point, Degree=3, Periodic=False, KnotStyle=2)  # -> Curve, Length, Domain

nurbs_curve_3 = NurbsCurve(Vertices=evaluate_length_10.Point, Degree=11, Periodic=False)  # -> Curve, Length, Domain

number_slider_12 = Slider(42, range=0..256)
curve_15 = Curve(interpolate_6.Curve)
number_9 = Number(number)
divide_curve_8 = DivideCurve(Curve=curve_15, Count=number_9, Kinks=False)  # -> Points, Tangents, Parameters
curvature_8 = Curvature(Curve=curve_15, Parameter=divide_curve_8.Parameters)  # -> Point, Curvature, Curvature_2
deconstruct_arc_8 = DeconstructArc(Arc=curvature_8.Curvature_2)  # -> BasePlane, Radius, Angle
one_over_x_9 = OneOverX(Value=deconstruct_arc_8.Radius)
panel_25 = Panel(one_over_x_9)
quick_graph_17 = QuickGraph(one_over_x_9, SortOrder=0)
line_6 = Line(StartPoint=curvature_8.Point, EndPoint=deconstruct_arc_8.BasePlane)
multiplication_4 = Multiplication(A=one_over_x_9, B=Slider(0.043994, range=0..0.5))
line_sdl_6 = LineSDL(Start=evaluate_length_10.Point, Direction=line_5, Length=expr("-ABS(X)", multiplication_4))
evaluate_length_11 = EvaluateLength(Curve=line_sdl_6, Length=1, Normalized=True)  # -> Point, Tangent, Parameter
interpolate_7 = Interpolate(Vertices=evaluate_length_11.Point, Degree=3, Periodic=False, KnotStyle=2)  # -> Curve, Length, Domain

nurbs_curve_4 = NurbsCurve(Vertices=evaluate_length_11.Point, Degree=11, Periodic=False)  # -> Curve, Length, Domain

digit_scroller_13 = DigitScroller(Scroller_Digits=12, Scroller_Prefix="Digit Scroller", Scroller_Radix=11, Scroller_Value=93)
curvature_graph_6 = CurvatureGraph(Curve=curve_12, Density=1, Scale=digit_scroller_13)
series_6 = Series(Start=0, Step=expr("1/X", number_7), Count=number_7)
construct_point_5 = ConstructPoint(XCoordinate=series_6, YCoordinate=expr("X/2", one_over_x_7), ZCoordinate=0)
polyline_4 = PolyLine(Vertices=construct_point_5, Closed=False)
quick_graph_18 = QuickGraph(one_over_x_7, SortOrder=0)
number_slider_13 = Slider(32, range=0..100)
explode_4 = Explode(Curve=polyline_4, Recursive=True)  # -> Segments, Vertices
number_slider_14 = Slider(31, range=0..100)
list_length_4 = ListLength(List=explode_4.Segments)  # -> expr("X/4", Length)
digit_scroller_14 = DigitScroller(Scroller_Digits=12, Scroller_Prefix="Digit Scroller", Scroller_Radix=11, Scroller_Value=64)
list_item_9 = ListItem(List=explode_4.Segments, Index=expr("X+(X/2)", list_length_4), Wrap=False)
list_item_10 = ListItem(List=explode_4.Segments, Index=expr("X-(X/2)", list_length_4), Wrap=False)
angle_7 = Angle(VectorA=list_item_9, VectorB=list_item_10)  # -> Angle, Reflex
expression_4 = Expression(X=angle_7.Angle, Expression="Format(\"{0:R}\", x)")
degrees_5 = Degrees(Radians=angle_7.Angle)
panel_26 = Panel(degrees_5)

merge = Merge(Data1=curve_6, Data2=curve_13, Data3=curve_7, Data4=curve_8)  # -> flatten(Result)
mirror_6 = Mirror(Geometry=merge, Plane=xz_plane)  # -> Geometry, Transform
move_6 = Move(Geometry=mirror_6.Geometry, Motion=Vector(0, -2.5, 0))  # -> Geometry, Transform
length = Length(Curve=line_sdl_5)
bounding_box_7 = BoundingBox(Content=merge, Plane=PlaneXY(0, 0, 0), UnionBox=True)  # -> Box, Box_2
sort_list = SortList(Keys=length, ValuesValuesA=line_sdl_5)  # -> reverse(Keys), reverse(ValuesValuesA)
deconstruct_box_7 = DeconstructBox(Box=bounding_box_7.Box)  # -> Plane, X, Y, Z
deconstruct_domain_11 = DeconstructDomain(Domain=deconstruct_box_7.Y)  # -> Start, End
mirror_7 = Mirror(Geometry=merge, Plane=xz_plane_2)  # -> Geometry, Transform
construct_domain_3 = ConstructDomain(DomainStart=expr("X*1.0971875", deconstruct_domain_11.Start), DomainEnd=expr("X*1.275", deconstruct_domain_11.End))
interpolate_8 = Interpolate(Vertices=construct_point_5, Degree=3, Periodic=False, KnotStyle=1)  # -> Curve, Length, Domain
list_item_11 = ListItem(List=sort_list.ValuesValuesA, Index=0, Wrap=False)
move_7 = Move(Geometry=mirror_7.Geometry, Motion=Vector(0, -2.5, 0))  # -> Geometry, Transform
rectangle_2 = Rectangle(Plane=PlaneXY(0, 0, 0), XSize=deconstruct_box_7.X, YSize=construct_domain_3, Radius=0)  # -> Rectangle, Length
panel_27 = Panel(list_item_11)
bounding_box_8 = BoundingBox(Content=interpolate_8.Curve, Plane=PlaneXY(0, 0, 0))  # -> Box, Box_2
deconstruct_box_8 = DeconstructBox(Box=bounding_box_8.Box)  # -> Plane, X, Y, Z
deconstruct_domain_12 = DeconstructDomain(Domain=deconstruct_box_8.X)  # -> Start, End
deconstruct_domain_13 = DeconstructDomain(Domain=deconstruct_box_8.Y)  # -> Start, End
scale_nu_3 = ScaleNU(
    Geometry=interpolate_8.Curve,
    Plane=PlaneXY(0, 0, 0),
    ScaleX=expr("1/X", deconstruct_domain_12.End),
    ScaleY=expr(".5/X", deconstruct_domain_13.End),
    ScaleZ=1)  # -> Geometry, Transform
move_8 = Move(Geometry=scale_nu_3.Geometry, Motion=vector_2pt_2.Vector)  # -> Geometry, Transform
move_9 = Move(Geometry=move_8.Geometry, Motion=Vector(0, -1, 0))  # -> Geometry, Transform
division_6 = Division(A=deconstruct_domain_9.End, B=deconstruct_domain_10.End)
panel_28 = Panel(division_6)

number_slider_15 = Slider(29, range=0..256)
number_10 = Number(number)
curve_16 = Curve([curve_6, curve_13])
divide_curve_9 = DivideCurve(Curve=curve_16, Count=number_10, Kinks=False)  # -> Points, Tangents, Parameters
curvature_9 = Curvature(Curve=curve_16, Parameter=divide_curve_9.Parameters)  # -> Point, Curvature, Curvature_2
deconstruct_arc_9 = DeconstructArc(Arc=curvature_9.Curvature_2)  # -> BasePlane, Radius, Angle
line_7 = Line(StartPoint=curvature_9.Point, EndPoint=deconstruct_arc_9.BasePlane)
one_over_x_10 = OneOverX(Value=deconstruct_arc_9.Radius)
relative_differences_10 = RelativeDifferences(Values=one_over_x_10)
quick_graph_19 = QuickGraph(relative_differences_10, SortOrder=0)
multiplication_5 = Multiplication(A=relative_differences_10, B=digit_scroller_4)
panel_29 = Panel(relative_differences_10)

point_4 = Point(curvature_9.Point)

line_sdl_7 = LineSDL(Start=point_4, Direction=line_7, Length=expr("-ABS(X)", multiplication_5))
evaluate_length_12 = EvaluateLength(Curve=line_sdl_7, Length=1, Normalized=True)  # -> Point, Tangent, Parameter
interpolate_9 = Interpolate(Vertices=evaluate_length_12.Point, Degree=3, Periodic=False, KnotStyle=2)  # -> Curve, Length, Domain

length_2 = Length(Curve=line_sdl_7)
sort_list_2 = SortList(Keys=length_2, ValuesA=line_sdl_7)  # -> reverse(Keys), reverse(ValuesA)
nurbs_curve_5 = NurbsCurve(Vertices=evaluate_length_12.Point, Degree=11, Periodic=False)  # -> Curve, Length, Domain
list_item_12 = ListItem(List=sort_list_2.ValuesA, Index=0, Wrap=False)
division_7 = Division(A=sort_list_2.Keys, B=sort_list.Keys)
mirror_8 = Mirror(Geometry=[line_sdl_7, interpolate_9.Curve], Plane=xz_plane_2)  # -> Geometry, Transform
move_10 = Move(Geometry=mirror_8.Geometry, Motion=Vector(0, -2.5, 0))  # -> Geometry, Transform
merge_2 = Merge(Data1=interpolate_6.Curve, Data2=move_10.Geometry)  # -> flatten(Result)
bounding_box_9 = BoundingBox(Content=merge_2, Plane=PlaneXY(0, 0, 0), UnionBox=True)  # -> Box, Box_2
panel_30 = Panel(list_item_12)
panel_31 = Panel(division_7)

number_slider_16 = Slider(29, range=0..256)
number_11 = Number(number)
curve_17 = Curve(curve)
divide_curve_10 = DivideCurve(Curve=curve_17, Count=number_11, Kinks=False)  # -> Points, Tangents, Parameters
curvature_10 = Curvature(Curve=curve_17, Parameter=divide_curve_10.Parameters)  # -> Point, Curvature, Curvature_2
deconstruct_arc_10 = DeconstructArc(Arc=curvature_10.Curvature_2)  # -> BasePlane, Radius, Angle
line_8 = Line(StartPoint=curvature_10.Point, EndPoint=deconstruct_arc_10.BasePlane)
one_over_x_11 = OneOverX(Value=deconstruct_arc_10.Radius)

relative_differences_11 = RelativeDifferences(Values=one_over_x_11)
move_11 = Move(Geometry=curvature_10.Point, Motion=Vector(0, 2.5, 0))  # -> Geometry, Transform

relative_differences_12 = RelativeDifferences(Values=relative_differences_11)
quick_graph_20 = QuickGraph(relative_differences_12, SortOrder=0)
multiplication_6 = Multiplication(A=relative_differences_12, B=Slider(9.996405, range=0..16))
line_sdl_8 = LineSDL(Start=move_11.Geometry, Direction=line_8, Length=expr("-ABS(X)", multiplication_6))
evaluate_length_13 = EvaluateLength(Curve=line_sdl_8, Length=1, Normalized=True)  # -> Point, Tangent, Parameter
interpolate_10 = Interpolate(Vertices=evaluate_length_13.Point, Degree=3, Periodic=False, KnotStyle=2)  # -> Curve, Length, Domain
panel_32 = Panel(relative_differences_12)

bounds = Bounds(Numbers=relative_differences_12)
remap_numbers = RemapNumbers(Value=relative_differences_12, Source=bounds, Target=Domain(-1, 1))  # -> Mapped, Clipped
nurbs_curve_6 = NurbsCurve(Vertices=evaluate_length_13.Point, Degree=11, Periodic=False)  # -> Curve, Length, Domain
move_12 = Move(Geometry=curve_17, Motion=Vector(0, 2.5, 0))  # -> Geometry, Transform

number_slider_17 = Slider(29, range=0..256)
number_12 = Number(number)
curve_18 = Curve(curve)
divide_curve_11 = DivideCurve(Curve=curve_18, Count=number_12, Kinks=False)  # -> Points, Tangents, Parameters
curvature_11 = Curvature(Curve=curve_18, Parameter=divide_curve_11.Parameters)  # -> Point, Curvature, Curvature_2
deconstruct_arc_11 = DeconstructArc(Arc=curvature_11.Curvature_2)  # -> BasePlane, Radius, Angle
line_9 = Line(StartPoint=curvature_11.Point, EndPoint=deconstruct_arc_11.BasePlane)
one_over_x_12 = OneOverX(Value=deconstruct_arc_11.Radius)

relative_differences_13 = RelativeDifferences(Values=one_over_x_12)
relative_differences_14 = RelativeDifferences(Values=relative_differences_13)
move_13 = Move(Geometry=curvature_11.Point, Motion=Vector(0, 3.5, 0))  # -> Geometry, Transform

relative_differences_15 = RelativeDifferences(Values=relative_differences_14)
quick_graph_21 = QuickGraph(relative_differences_15, SortOrder=0)
multiplication_7 = Multiplication(A=relative_differences_15, B=Slider(11.450938, range=0..16))
line_sdl_9 = LineSDL(Start=move_13.Geometry, Direction=line_9, Length=expr("-ABS(X)", multiplication_7))
evaluate_length_14 = EvaluateLength(Curve=line_sdl_9, Length=1, Normalized=True)  # -> Point, Tangent, Parameter
interpolate_11 = Interpolate(Vertices=evaluate_length_14.Point, Degree=3, Periodic=False, KnotStyle=2)  # -> Curve, Length, Domain
panel_33 = Panel(relative_differences_15)

bounds_2 = Bounds(Numbers=relative_differences_15)
remap_numbers_2 = RemapNumbers(Value=relative_differences_15, Source=bounds_2, Target=Domain(-1, 1))  # -> Mapped, Clipped
nurbs_curve_7 = NurbsCurve(Vertices=evaluate_length_14.Point, Degree=11, Periodic=False)  # -> Curve, Length, Domain
move_14 = Move(Geometry=curve_18, Motion=Vector(0, 3.5, 0))  # -> Geometry, Transform

number_slider_18 = Slider(29, range=0..256)
number_13 = Number(number)
curve_19 = Curve(curve)
divide_curve_12 = DivideCurve(Curve=curve_19, Count=number_13, Kinks=False)  # -> Points, Tangents, Parameters
curvature_12 = Curvature(Curve=curve_19, Parameter=divide_curve_12.Parameters)  # -> Point, Curvature, Curvature_2
deconstruct_arc_12 = DeconstructArc(Arc=curvature_12.Curvature_2)  # -> BasePlane, Radius, Angle
line_10 = Line(StartPoint=curvature_12.Point, EndPoint=deconstruct_arc_12.BasePlane)
one_over_x_13 = OneOverX(Value=deconstruct_arc_12.Radius)

relative_differences_16 = RelativeDifferences(Values=one_over_x_13)
relative_differences_17 = RelativeDifferences(Values=relative_differences_16)
relative_differences_18 = RelativeDifferences(Values=relative_differences_17)

relative_differences_19 = RelativeDifferences(Values=relative_differences_18)
quick_graph_22 = QuickGraph(relative_differences_19, SortOrder=0)
multiplication_8 = Multiplication(A=relative_differences_19, B=Slider(4, range=0..4))
line_sdl_10 = LineSDL(Start=curvature_12.Point, Direction=line_10, Length=expr("-ABS(X)", multiplication_8))
evaluate_length_15 = EvaluateLength(Curve=line_sdl_10, Length=1, Normalized=True)  # -> Point, Tangent, Parameter
interpolate_12 = Interpolate(Vertices=evaluate_length_15.Point, Degree=3, Periodic=False, KnotStyle=2)  # -> Curve, Length, Domain
panel_34 = Panel(relative_differences_19)

nurbs_curve_8 = NurbsCurve(Vertices=evaluate_length_15.Point, Degree=11, Periodic=False)  # -> Curve, Length, Domain
