# Grasshopper definition XHG.TЯPDLƧ.ⵙⵘⵙ◯ⵙᔓᔕⵙᑎⵙИNⵙᗱᗴⵙᕤᕦⵙᴥⵙᗱᗴⵙߦⵙ人ⵙ옷ⵙ◯ⵙИNⵙⓄⵙᴥⵙᗝⵙᗱᗴⵙ옷ⵙᗩⵙ✤ⵙᑐᑕⵙⓄⵙ8ⵙᑎⵙᑐᑕⵙ⊚ⵙ◌ⵙ⊚ⵙ◌ⵙ⊚ⵙ◌ⵙ⚪ⵙ◯ⵙ◯ⵙ⚪ⵙ◌ⵙ⊚ⵙ◌ⵙ⊚ⵙ◌ⵙ⊚ⵙᑐᑕⵙᑎⵙ8ⵙⓄⵙᑐᑕⵙ✤ⵙᗩⵙ옷ⵙᗱᗴⵙᗝⵙᴥⵙⓄⵙИNⵙ◯ⵙ옷ⵙ人ⵙߦⵙᗱᗴⵙᴥⵙᕤᕦⵙᗱᗴⵙИNⵙᑎⵙᔓᔕⵙ◯ⵙⵘⵙ.SLDPRT.GHX (Grasshopper 1.0.7)
# plug-ins: MeshEdit Components, Pancake

panel = Panel("0.2756013610640554832018211809411934093644161529690267726892185599")
curve = Curve(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)
curve_domain = CurveDomain(Curve=curve)  # -> Curve, Domain
deconstruct_domain = DeconstructDomain(Domain=curve_domain.Domain)  # -> Start, End
subtraction = Subtraction(A=deconstruct_domain.End, B=deconstruct_domain.Start)
multiplication = Multiplication(A=panel, B=subtraction)
addition = Addition(A=deconstruct_domain.Start, B=multiplication)
construct_domain = ConstructDomain(DomainStart=deconstruct_domain.Start, DomainEnd=addition)
sub_curve = SubCurve(BaseCurve=curve_domain.Curve, Domain=construct_domain)
digit_scroller = DigitScroller(Scroller_Digits=12, Scroller_Prefix=" ", Scroller_Radix=11, Scroller_Value=4)
digit_scroller_2 = DigitScroller(Scroller_Digits=12, Scroller_Prefix=" ", Scroller_Radix=1, Scroller_Value=7.555122055)
panel_2 = Panel("4.3137948526439035")
radians = Radians(Degrees=120)
line = Line(StartPoint=Point(0, 0, 0), EndPoint=Point(-0.2311250816, 0.2311250816, 0.2311250816))
curve_2 = Curve(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)
curve_3 = Curve(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)
merge = Merge(Data1=curve_2, Data2=curve_3)
join_curves = JoinCurves(Curves=merge, Preserve=False)
flip_curve = FlipCurve(Curve=join_curves)  # -> Curve, Flag
range = Range(Domain=Domain(0, 1), Steps=digit_scroller)
expression = Expression(O=range, OO="7.55512205489074473", Expression="1-(1/( (OO) ^ (O) ))")
number_slider = Slider(0.66, range=0..1)
curve_4 = Curve(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)
flip_curve_2 = FlipCurve(Curve=curve_4)  # -> Curve, Flag
curve_5 = Curve(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)
point_on_curve = PointOnCurve(curve_2, parameter=1)
panel_3 = Panel("0.2756013610640554832018211809411934093644161529690267726892185599")
rotate = Rotate(Geometry=join_curves, Angle=radians, Plane=line)  # -> Geometry, Transform
bounds = Bounds(Numbers=expression)
remap_numbers = RemapNumbers(Value=expression, Source=bounds, Target=Domain(0, 1))  # -> Mapped, Clipped
evaluate_length = EvaluateLength(Curve=flip_curve.Curve, Length=remap_numbers.Mapped, Normalized=True)  # -> Point, Tangent, Parameter
rotate_2 = Rotate(Geometry=evaluate_length.Point, Angle=radians, Plane=line)  # -> Geometry, Transform
line_2 = Line(StartPoint=evaluate_length.Point, EndPoint=rotate_2.Geometry)
curve_middle = CurveMiddle(Curve=line_2)
tween_curve = TweenCurve(CurveA=flip_curve_2.Curve, CurveB=curve_5, Factor=remap_numbers.Mapped, BlendType=0)
list_item = ListItem(List=tween_curve, Index=2, Wrap=False)
curve_middle_2 = CurveMiddle(Curve=list_item)
curve_closest_point = CurveClosestPoint(Point=curve_middle_2, Curve=<geometry referenced from the Rhino model>)  # -> Point, Parameter, Distance
list_item_2 = ListItem(List=remap_numbers.Mapped, Index=1, Wrap=False)
line_3 = Line(StartPoint=Point(0, 0, 0), EndPoint=curve_middle_2)
rotate_3 = Rotate(Geometry=<curve referenced from the Rhino model>, Angle=1.570796327, Plane=line_3)  # -> Geometry, Transform
merge_2 = Merge(Data1=evaluate_length.Point, Data2=curve_middle, Data3=rotate_2.Geometry)
curve_6 = Curve(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)
curve_domain_2 = CurveDomain(Curve=curve_6)  # -> Curve, Domain
deconstruct_domain_2 = DeconstructDomain(Domain=curve_domain_2.Domain)  # -> Start, End
subtraction_2 = Subtraction(A=deconstruct_domain_2.End, B=deconstruct_domain_2.Start)
multiplication_2 = Multiplication(A=panel_3, B=subtraction_2)
addition_2 = Addition(A=deconstruct_domain_2.Start, B=multiplication_2)
construct_domain_2 = ConstructDomain(DomainStart=deconstruct_domain_2.Start, DomainEnd=addition_2)
sub_curve_2 = SubCurve(BaseCurve=curve_domain_2.Curve, Domain=construct_domain_2)
point_on_curve_2 = PointOnCurve(sub_curve_2, parameter=1)
curve_closest_point_2 = CurveClosestPoint(Point=point_on_curve_2, Curve=list_item)  # -> Point, Parameter, Distance
list_item_3 = ListItem(List=merge_2, Index=Slider(5, range=0..14), Wrap=False)
number = Number([12, 11, 6, 7])
list_item_4 = ListItem(List=merge_2, Index=number, Wrap=False)
construct_mesh = ConstructMesh(Vertices=list_item_4, Faces={A=0, B=1, C=2, D=3})
number_2 = Number([14, 13, 8, 9])
list_item_5 = ListItem(List=merge_2, Index=number_2, Wrap=False)
construct_mesh_2 = ConstructMesh(Vertices=list_item_5, Faces={A=0, B=1, C=2, D=3})
number_3 = Number([2, 1, 6, 7])
list_item_6 = ListItem(List=merge_2, Index=number_3, Wrap=False)
construct_mesh_3 = ConstructMesh(Vertices=list_item_6, Faces={A=0, B=1, C=2, D=3})
number_4 = Number([4, 3, 8, 9])
list_item_7 = ListItem(List=merge_2, Index=number_4, Wrap=False)
construct_mesh_4 = ConstructMesh(Vertices=list_item_7, Faces={A=0, B=1, C=2, D=3})
number_5 = Number([10, 11, 6, 5])
list_item_8 = ListItem(List=merge_2, Index=number_5, Wrap=False)
construct_mesh_5 = ConstructMesh(Vertices=list_item_8, Faces={A=0, B=1, C=2, D=3})
number_6 = Number([12, 13, 8, 7])
list_item_9 = ListItem(List=merge_2, Index=number_6, Wrap=False)
construct_mesh_6 = ConstructMesh(Vertices=list_item_9, Faces={A=0, B=1, C=2, D=3})
true_only_button = TrueOnlyButton(LastSaveLocalization="neutral,N")
geometry = Geometry([<brep referenced from the Rhino model> x20])
simple_mesh = SimpleMesh(Brep=geometry)
number_7 = Number([0, 1, 6, 5])
list_item_10 = ListItem(List=merge_2, Index=number_7, Wrap=False)
construct_mesh_7 = ConstructMesh(Vertices=list_item_10, Faces={A=0, B=1, C=2, D=3})
number_8 = Number([2, 3, 8, 7])
list_item_11 = ListItem(List=merge_2, Index=number_8, Wrap=False)
construct_mesh_8 = ConstructMesh(Vertices=list_item_11, Faces={A=0, B=1, C=2, D=3})
merge_3 = Merge(
    Data1=construct_mesh_2,
    Data2=construct_mesh_4,
    Data3=construct_mesh_6,
    Data4=construct_mesh_8,
    Data5=construct_mesh,
    Data6=construct_mesh_3,
    Data7=construct_mesh_5,
    Data8=construct_mesh_7)
mesh_join = MeshJoin(Meshes=merge_3)
merge_4 = Merge(Data1=simple_mesh, Data2=mesh_join)
mesh_join_2 = MeshJoin(Meshes=merge_4)
mirror = Mirror(Geometry=mesh_join_2, Plane=PlaneYZ(0, 0, 0))  # -> Geometry, Transform
merge_5 = Merge(Data1=mesh_join_2, Data2=mirror.Geometry)
mirror_2 = Mirror(Geometry=merge_5, Plane=Plane(origin=(0, 0, 0), x=(0, 0, 1), y=(1, 0, 0)))  # -> Geometry, Transform
merge_6 = Merge(Data1=merge_5, Data2=mirror_2.Geometry)
mirror_3 = Mirror(Geometry=merge_6, Plane=PlaneXY(0, 0, 0))  # -> Geometry, Transform
merge_7 = Merge(Data1=merge_6, Data2=mirror_3.Geometry)
mirror_4 = Mirror(Geometry=merge_7, Plane=Plane(origin=(0, 0, 0), x=(0.7071067812, 0, -0.7071067812), y=(0, 1, 0)))  # -> Geometry, Transform
mirror_5 = Mirror(Geometry=merge_7, Plane=Plane(origin=(0, 0, 0), x=(1, 0, 0), y=(0, 0.7071067812, 0.7071067812)))  # -> Geometry, Transform
merge_8 = Merge(Data1=merge_7, Data2=mirror_4.Geometry, Data3=mirror_5.Geometry)  # -> flatten(Result)
mesh_join_3 = MeshJoin(Meshes=merge_8)
mesh_weldvertices = MeshWeldVertices(Mesh=mesh_join_3, Tolerance=1.525878906e-05)  # -> RuntimeMessage, Mesh
export_as = ExportAs(
    Geometry=mesh_weldvertices.Mesh,
    FileLocation="C:\JBO.OBJ",
    Overwrite=True,
    Export=true_only_button,
    CompMode=False,
    LastSaveLocalization="neutral,N",
    RestoreState=True,
    TreatGhGeoAsRef=True)  # -> OK, ExportCommand
