# Grasshopper definition XHG.⠀ⵙИNⵙⓄⵙꖴⵙ✤ⵙᑐᑕⵙᑎⵙᗝⵙⓄⵙᴥⵙߦⵙ⠀◯⠀ⵙᗩⵙᗝⵙᙁⵙᗱᗴⵙᙏⵙ⠀◯⠀ⵙᴥⵙⓄⵙꗳⵙ⠀◯⠀ⵙᗯⵙᔓᔕⵙᑐᑕⵙ⠀◯⠀ⵙᔓᔕⵙᗱᗴ✤ⵙᗩⵙИNⵙꖴⵙᗝⵙᴥⵙⓄⵙᑐᑕⵙ⠀◯⠀ⵙ✤ⵙИNⵙꖴⵙⓄⵙߦⵙ⠀◯⠀ⵙᗱᗴⵙᗯⵙᴥⵙᑎⵙᑐᑕⵙ⠀◯⠀ⵙ⠀◯⠀ⵙᑐᑕⵙᑎⵙᴥⵙᗯⵙᗱᗴⵙ⠀◯⠀ⵙߦⵙⓄⵙꖴⵙИNⵙ✤ⵙ⠀◯⠀ⵙᑐᑕⵙⓄⵙᴥⵙᗝⵙꖴⵙИNⵙᗩⵙ✤ᗱᗴⵙᔓᔕⵙ⠀◯⠀ⵙᑐᑕⵙᔓᔕⵙᗯⵙ⠀◯⠀ⵙꗳⵙⓄⵙᴥⵙ⠀◯⠀ⵙᙏⵙᗱᗴⵙᙁⵙᗝⵙᗩⵙ⠀◯⠀ⵙߦⵙᴥⵙⓄⵙᗝⵙᑎⵙᑐᑕⵙ✤ⵙꖴⵙⓄⵙИNⵙ⠀.GHX (Grasshopper 1.0.7)

digit_scroller = DigitScroller(Scroller_Digits=12, Scroller_Prefix=" ", Scroller_Radix=11, Scroller_Value=256)
arc = Arc(Plane=Plane(origin=(0.5, 1, 0), x=(0, -1, 0), y=(1, 0, 0)), Radius=0.5, Angle=Domain(0, 1.570796327))  # -> Arc, Length
arc_2 = Arc(Plane=Plane(origin=(0.5, 0, 0), x=(0, 1, 0), y=(-1, 0, 0)), Radius=0.5, Angle=Domain(0, 1.570796327))  # -> Arc, Length
join_curves = JoinCurves(Curves=[arc.Arc, arc_2.Arc], Preserve=False)
file_path = FilePath("C:\VSC.XHG.O____NOITCUDORPADLEM_ROF_WSC_SETANIDROC_TNIOP_EWRUC____O____CURWE_POINT_CORDINATES_CSW_FOR_MELDAPRODUCTION____O.GHX.CSV")
construct_domain = ConstructDomain(DomainStart=0, DomainEnd=expr("X/2", 1))
range = Range(Domain=construct_domain, Steps=expr("X/2-0", digit_scroller))
expression = Expression(O=range, Expression="sin( 4*atan(1) * O / 1 )/2")
construct_point = ConstructPoint(XCoordinate=range, YCoordinate=expression, ZCoordinate=0)
list_length = ListLength(List=construct_point)
list_item = ListItem(List=construct_point, Index=expr("X-1", list_length), Wrap=False)
rotate = Rotate(Geometry=construct_point, Angle=3.141592654, Plane=list_item)  # -> reverse(Geometry), Transform
merge = Merge(Data1=construct_point, Data2=rotate.Geometry)
cull_duplicates = CullDuplicates(Points=merge, Tolerance=0, CullMode=3)  # -> Points, Indices, Valence
interpolate = Interpolate(Vertices=cull_duplicates.Points, Degree=3, Periodic=False, KnotStyle=1)  # -> Curve, Length, Domain
end_points = EndPoints(Curve=interpolate.Curve)  # -> Start, End
line = Line(StartPoint=end_points.Start, EndPoint=end_points.End)
mirror = Mirror(Geometry=interpolate.Curve, Plane=line)  # -> Geometry, Transform
move = Move(Geometry=mirror.Geometry, Motion=Vector(1, 1, 0))  # -> Geometry, Transform
flip_curve = FlipCurve(Curve=move.Geometry)  # -> Curve, Flag
curve = Curve(flip_curve.Curve)
divide_curve = DivideCurve(Curve=curve, Count=expr("X-1", digit_scroller), Kinks=False)  # -> Points, Tangents, Parameters
deconstruct = Deconstruct(Point=divide_curve.Points)  # -> graft(XComponent), graft(YComponent), graft(ZComponent)
expression_2 = Expression(O=deconstruct.YComponent, Expression="FORMAT(\"{0:0.000000}\",O)")
expression_3 = Expression(O=deconstruct.XComponent, Expression="FORMAT(\"{0:0.000000}\",O)")
panel = Panel(expression_2)
panel_2 = Panel(expression_3)
concatenate = Concatenate(FragmentA=panel_2, FragmentB=";", FragmentA_2=panel)
panel_3 = Panel(concatenate)
txtwriter = VBScript(filePath=file_path, data=flatten(panel_3), activate=Button())  # -> out, A; inputs data: list
# ---------- txtwriter: VB ----------
    If activate Then

      Dim i As Integer
      Dim aryText(4) As String

      aryText(0) = "Mary WriteLine"
      aryText(1) = "Had"
      aryText(2) = "Another"
      aryText(3) = "Little"
      aryText(4) = "One"

      ' the data is appended to the file. If file doesnt exist, a new file is created
      Dim objWriter As New System.IO.StreamWriter(filePath, append)

      For i = 0 To data.Count - 1
        objWriter.WriteLine(data(i))
      Next

      objWriter.Close()

    End If

    If clearFile Then
      Dim objWriter As New System.IO.StreamWriter(filePath, False)
      objWriter.Close()
    End If
# ---------- end txtwriter ----------
