# Grasshopper definition XHG..𖣠⚪𔗢⚪ИN⚪Ⓞ⚪ᔓᔕ⚪ꖴ⚪ᴥ⚪ᗩ⚪ߦ⚪ᙏ⚪Ⓞ⚪ᑐᑕ⚪𖣓⚪ᗱᗴ⚪ᗯ⚪ᴥ⚪ᑎ⚪ᑐᑕ⚪𔗢⚪𖣓⚪𔗢⚪𖣠⚪𔗢⚪𖡼⚪𔗢⚪𖣠⚪𔗢⚪𖡼⚪𔗢⚪𖣠⚪𔗢⚪𖡼⚪𔗢⚪𖣠⚪𔗢⚪𖡼⚪𔗢⚪🞋⚪𔗢⚪𖡼⚪𔗢⚪𖣠⚪𔗢⚪𖡼⚪𔗢⚪𖣠⚪𔗢⚪𖡼⚪𔗢⚪𖣠⚪𔗢⚪𖡼⚪𔗢⚪𖣠⚪𔗢⚪𖣓⚪𔗢⚪ᑐᑕ⚪ᑎ⚪ᴥ⚪ᗯ⚪ᗱᗴ⚪𖣓⚪ᑐᑕ⚪Ⓞ⚪ᙏ⚪ߦ⚪ᗩ⚪ᴥ⚪ꖴ⚪ᔓᔕ⚪Ⓞ⚪ИN⚪𔗢⚪𖣠..GHX (Grasshopper 1.0.7)
# plug-ins: Heteroptera, Pufferfish

digit_scroller = DigitScroller(Scroller_Digits=12, Scroller_Prefix=" ", Scroller_Radix=11, Scroller_Value=16)
power = Power(A="2", B=digit_scroller)
digit_scroller_2 = DigitScroller(Scroller_Digits=12, Scroller_Prefix=".", Scroller_Radix=11, Scroller_Value=1024)
digit_scroller_3 = DigitScroller(Scroller_Digits=12, Scroller_Prefix="°", Scroller_Radix=2, Scroller_Value=0.0005104413)
яr = DigitScroller(Scroller_Digits=12, Scroller_Prefix=" ЯR", Scroller_Radix=1, Scroller_Value=0.1196340341)
digit_scroller_4 = DigitScroller(Scroller_Digits=12, Scroller_Prefix=".", Scroller_Radix=11, Scroller_Value=1024)
digit_scroller_5 = DigitScroller(Scroller_Digits=12, Scroller_Prefix="°", Scroller_Radix=2, Scroller_Value=0.0003959052)
яr_2 = DigitScroller(Scroller_Digits=12, Scroller_Prefix=" ЯR", Scroller_Radix=1, Scroller_Value=0.1217714274)
digit_scroller_6 = DigitScroller(Scroller_Digits=12, Scroller_Prefix=".", Scroller_Radix=11, Scroller_Value=1024)
digit_scroller_7 = DigitScroller(Scroller_Digits=12, Scroller_Prefix="°", Scroller_Radix=2, Scroller_Value=0.0003860762)
яr_3 = DigitScroller(Scroller_Digits=12, Scroller_Prefix=" ЯR", Scroller_Radix=1, Scroller_Value=0.1222057435)
division = Division(A="360", B=digit_scroller_2)
digit_scroller_8 = DigitScroller(Scroller_Digits=12, Scroller_Prefix=".", Scroller_Radix=11, Scroller_Value=1024)
digit_scroller_9 = DigitScroller(Scroller_Digits=12, Scroller_Prefix="°", Scroller_Radix=2, Scroller_Value=0.0003860762)
яr_4 = DigitScroller(Scroller_Digits=12, Scroller_Prefix=" ЯR", Scroller_Radix=1, Scroller_Value=0.1222857435)
division_2 = Division(A="360", B=digit_scroller_4)
division_3 = Division(A=digit_scroller_2, B=2)
division_4 = Division(A="360", B=digit_scroller_6)
division_5 = Division(A=digit_scroller_4, B=2)
radians = Radians(Degrees="0.000510441291375068915")
division_6 = Division(A="360", B=digit_scroller_8)
expression = Expression(R=яr, N=division_3, Expression="R/(.5*(1/SIN(π/N)))")
radians_2 = Radians(Degrees="0.0003959052400654102")
division_7 = Division(A=digit_scroller_6, B=2)
expression_2 = Expression(R=яr_2, N=division_5, Expression="R/(.5*(1/SIN(π/N)))")
division_8 = Division(A=digit_scroller_8, B=2)
duplicate_data = DuplicateData(Data=expression, Number=division_3, Order=True)
radians_3 = Radians(Degrees="0.0003860762109180463019")
series = Series(Start=radians, Step=radians, Count=division_3)
duplicate_data_2 = DuplicateData(Data=expression_2, Number=division_5, Order=True)
expression_3 = Expression(R=яr_3, N=division_7, Expression="R/(.5*(1/SIN(π/N)))")
radians_4 = Radians(Degrees="0.0003845696719497810789")
series_2 = Series(Start=radians_2, Step=radians_2, Count=division_5)
expression_4 = Expression(N=division_3, Expression="cos((4*atan(1))/N)")
reverse_list = ReverseList(List=series)
expression_5 = Expression(R=яr_4, N=division_8, Expression="R/(.5*(1/SIN(π/N)))")
digit_scroller_10 = DigitScroller(Scroller_Digits=12, Scroller_Prefix="Digit Scroller", Scroller_Radix=11, Scroller_Value=8)
expression_6 = Expression(N=division_8, Expression="cos((4*atan(1))/N)")
expression_7 = Expression(L=яr, N=division_3, Expression=".5*L*(1/SIN(π/N))")
duplicate_data_3 = DuplicateData(Data=expression_3, Number=division_7, Order=True)
reverse_list_2 = ReverseList(List=series_2)
multiplication = Multiplication(A=reverse_list_2, B=power)
series_3 = Series(Start=radians_3, Step=radians_3, Count=division_7)
digit_scroller_11 = DigitScroller(Scroller_Digits=12, Scroller_Prefix="Digit Scroller", Scroller_Radix=11, Scroller_Value=63)
digit_scroller_12 = DigitScroller(Scroller_Digits=12, Scroller_Prefix="Digit Scroller", Scroller_Radix=11, Scroller_Value=3)
reverse_list_3 = ReverseList(List=duplicate_data)
expression_8 = Expression(N=division_5, Expression="cos((4*atan(1))/N)")
reverse_list_4 = ReverseList(List=duplicate_data_2)
duplicate_data_4 = DuplicateData(Data=expression_5, Number=division_8, Order=True)
series_4 = Series(Start=radians_4, Step=radians_4, Count=division_8)
subtraction = Subtraction(A=digit_scroller_12, B="1")
expression_9 = Expression(L=яr_2, N=division_5, Expression=".5*L*(1/SIN(π/N))")
bounds = Bounds(Numbers=multiplication)
expression_10 = Expression(N=division_7, Expression="cos((4*atan(1))/N)")
negative = Negative(Value=series)
merge = Merge(Data1=flatten(reverse_list), Data2=flatten("0"), Data3=flatten(negative))  # -> flatten(Result)
reverse_list_5 = ReverseList(List=series_3)
multiplication_2 = Multiplication(A=reverse_list_5, B=power)
reverse_list_6 = ReverseList(List=duplicate_data_3)
reverse_list_7 = ReverseList(List=series_4)
multiplication_3 = Multiplication(A=reverse_list_7, B=power)
reverse_list_8 = ReverseList(List=duplicate_data_4)
merge_2 = Merge(Data1=flatten(reverse_list_3), Data3=flatten(duplicate_data))  # -> flatten(Result)
power_2 = Power(A="2", B=subtraction)
merge_3 = Merge(Data1=flatten(reverse_list_4), Data3=flatten(duplicate_data_2))  # -> flatten(Result)
expression_11 = Expression(L=яr_3, N=division_7, Expression=".5*L*(1/SIN(π/N))")
bounds_2 = Bounds(Numbers=multiplication_2)
multiplication_4 = Multiplication(A=digit_scroller_10, B=power_2)
bounds_3 = Bounds(Numbers=multiplication_3)
expression_12 = Expression(L=яr_4, N=division_8, Expression=".5*L*(1/SIN(π/N))")
multiplication_5 = Multiplication(A=digit_scroller_11, B=power_2)
panel = Panel(expression_7)
turtle = DotNETVBScriptLEGACY(Forward=merge_2, Left=merge)  # -> Output, Points; inputs Forward: list, Left: list
# ---------- turtle: VB ----------
    Dim i As Integer
    Dim dir As New On3dVector(1, 0, 0)
    Dim pos As New On3dVector(0, 0, 0)
    Dim axis As New On3dVector(0, 0, 1)
    Dim pnts As New List(Of On3dVector)

    pnts.Add(pos)

    For i = 0 To Forward.Count() - 1
      Dim P As New On3dVector
      dir.Rotate(Left(i), axis)
      P = dir * Forward(i) + pnts(i)
      pnts.Add(P)

    Next

    Points = pnts
# ---------- end turtle ----------
point = Point(turtle.Points)
circle_fit = CircleFit(Points=point)  # -> Circle, Radius, Deviation
area = Area(Geometry=circle_fit.Circle)  # -> Area, Centroid
scale = Scale(Geometry=circle_fit.Circle, Center=area.Centroid, Factor=expression_4)  # -> Geometry, Transform
panel_2 = Panel(circle_fit.Radius)
multiplication_6 = Multiplication(A=expression_4, B=circle_fit.Radius)
list_item = ListItem(List=point, Index=-1, Wrap=True)
deconstruct = Deconstruct(Point=list_item)  # -> XComponent, YComponent, ZComponent
format = Format(Format="{0:R}", Culture=127, Data0=deconstruct.XComponent)
format_2 = Format(Format="{0:R}", Culture=127, Data0=deconstruct.YComponent)
scale_nu = ScaleNU(
    Geometry=point,
    Plane=PlaneXY(0, 0, 0),
    ScaleX=expr("1/X", deconstruct.XComponent),
    ScaleY=expr("1/X", deconstruct.YComponent),
    ScaleZ=1)  # -> Geometry, Transform
interpolate = Interpolate(Vertices=scale_nu.Geometry, Degree=3, Periodic=False, KnotStyle=2)  # -> Curve, Length, Domain
scale_2 = Scale(Geometry=interpolate.Curve, Center=Point(0, 0, 0), Factor=power)  # -> Geometry, Transform
end_points = EndPoints(Curve=scale_2.Geometry)  # -> Start, End
rectangle_2pt = Rectangle2Pt(Plane=PlaneXY(0, 0, 0), PointA=end_points.Start, PointB=end_points.End, Radius=0)  # -> Rectangle, Length
curve_graph_mapper = CurveGraphMapper(
    Curves=scale_2.Geometry,
    Rectangle=rectangle_2pt.Rectangle,
    Values=multiplication,
    XAxis=bounds,
    YAxis=bounds,
    Flip=False,
    Snap=False,
    TextSize=0.0625)  # -> Mapped, GraphCurves, GraphPoints, ValueLines, ValuePoints, MappedLines, MappedPoints, Boundary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; disabled
graphmapper = GraphMapper(Curve=scale_2.Geometry, Boundary=rectangle_2pt.Rectangle, Numbers=multiplication, Input=bounds, Output=bounds, bobo=True)
merge_4 = Merge(Data1=flatten(reverse_list_6), Data3=flatten(duplicate_data_3))  # -> flatten(Result)
merge_5 = Merge(Data1=flatten(reverse_list_8), Data3=flatten(duplicate_data_4))  # -> flatten(Result)
pi = Pi(Factor=multiplication_4)
panel_3 = Panel(expression_9)
division_9 = Division(A=graphmapper, B=power)
digit_scroller_13 = DigitScroller(Scroller_Digits=12, Scroller_Prefix="Digit Scroller", Scroller_Radix=2, Scroller_Value=0.5)
panel_4 = Panel(expression_11)
panel_5 = Panel(merge)
pi_2 = Pi(Factor=2)
digit_scroller_14 = DigitScroller(Scroller_Digits=12, Scroller_Prefix="Digit Scroller", Scroller_Radix=2, Scroller_Value=0.0625)
reverse_list_9 = ReverseList(List=division_9)
negative_2 = Negative(Value=reverse_list_9)
merge_6 = Merge(Data1=flatten(division_9), Data2=flatten("0"), Data3=flatten(negative_2))  # -> flatten(Result)
turtle_2 = DotNETVBScriptLEGACY(Forward=merge_3, Left=merge_6)  # -> Output, Points; inputs Forward: list, Left: list; same code as turtle
point_2 = Point(turtle_2.Points)
circle_fit_2 = CircleFit(Points=point_2)  # -> Circle, Radius, Deviation
area_2 = Area(Geometry=circle_fit_2.Circle)  # -> Area, Centroid
scale_3 = Scale(Geometry=circle_fit_2.Circle, Center=area_2.Centroid, Factor=expression_8)  # -> Geometry, Transform
panel_6 = Panel(circle_fit_2.Radius)
multiplication_7 = Multiplication(A=expression_8, B=circle_fit_2.Radius)
list_item_2 = ListItem(List=point_2, Index=-1, Wrap=True)
deconstruct_2 = Deconstruct(Point=list_item_2)  # -> XComponent, YComponent, ZComponent
format_3 = Format(Format="{0:R}", Culture=127, Data0=deconstruct_2.XComponent)
format_4 = Format(Format="{0:R}", Culture=127, Data0=deconstruct_2.YComponent)
scale_nu_2 = ScaleNU(
    Geometry=point_2,
    Plane=PlaneXY(0, 0, 0),
    ScaleX=expr("1/X", deconstruct_2.XComponent),
    ScaleY=expr("1/X", deconstruct_2.YComponent),
    ScaleZ=1)  # -> Geometry, Transform
interpolate_2 = Interpolate(Vertices=scale_nu_2.Geometry, Degree=3, Periodic=False, KnotStyle=2)  # -> Curve, Length, Domain
scale_4 = Scale(Geometry=interpolate_2.Curve, Center=Point(0, 0, 0), Factor=power)  # -> Geometry, Transform
end_points_2 = EndPoints(Curve=scale_4.Geometry)  # -> Start, End
rectangle_2pt_2 = Rectangle2Pt(Plane=PlaneXY(0, 0, 0), PointA=end_points_2.Start, PointB=end_points_2.End, Radius=0)  # -> Rectangle, Length
curve_graph_mapper_2 = CurveGraphMapper(
    Curves=scale_4.Geometry,
    Rectangle=rectangle_2pt_2.Rectangle,
    Values=multiplication_2,
    XAxis=bounds_2,
    YAxis=bounds_2,
    Flip=False,
    Snap=True,
    TextSize=0.0625)  # -> Mapped, GraphCurves, GraphPoints, ValueLines, ValuePoints, MappedLines, MappedPoints, Boundary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; disabled
graphmapper_2 = GraphMapper(
    Curve=scale_4.Geometry,
    Boundary=rectangle_2pt_2.Rectangle,
    Numbers=multiplication_2,
    Input=bounds_2,
    Output=bounds_2,
    bobo=True)
division_10 = Division(A=pi, B=multiplication_5)
panel_7 = Panel(expression_12)
series_5 = Series(Start=0, Step=division_10, Count=multiplication_5)
division_11 = Division(A=graphmapper_2, B=power)
division_12 = Division(A=deconstruct.XComponent, B=deconstruct.YComponent)
format_5 = Format(Format="{0:R}", Culture=127, Data0=division_12)

panel_8 = Panel(format)
panel_9 = Panel(format_5)
panel_10 = Panel(format_2)

digit_scroller_15 = DigitScroller(Scroller_Digits=12, Scroller_Prefix="Digit Scroller", Scroller_Radix=2, Scroller_Value=0.0625)
division_13 = Division(A=deconstruct_2.XComponent, B=deconstruct_2.YComponent)
format_6 = Format(Format="{0:R}", Culture=127, Data0=division_13)

panel_11 = Panel(format_3)
panel_12 = Panel(format_6)
panel_13 = Panel(format_4)

panel_14 = Panel(merge_6)
power_3 = Power(A=series_5, B="2")
reverse_list_10 = ReverseList(List=division_11)
negative_3 = Negative(Value=reverse_list_10)
merge_7 = Merge(Data1=flatten(division_11), Data2=flatten("0"), Data3=flatten(negative_3))  # -> flatten(Result)
turtle_3 = DotNETVBScriptLEGACY(Forward=merge_4, Left=merge_7)  # -> Output, Points; inputs Forward: list, Left: list; same code as turtle
point_3 = Point(turtle_3.Points)
circle_fit_3 = CircleFit(Points=point_3)  # -> Circle, Radius, Deviation
area_3 = Area(Geometry=circle_fit_3.Circle)  # -> Area, Centroid
scale_5 = Scale(Geometry=circle_fit_3.Circle, Center=area_3.Centroid, Factor=expression_10)  # -> Geometry, Transform
panel_15 = Panel(circle_fit_3.Radius)
multiplication_8 = Multiplication(A=expression_10, B=circle_fit_3.Radius)
list_item_3 = ListItem(List=point_3, Index=-1, Wrap=True)
deconstruct_3 = Deconstruct(Point=list_item_3)  # -> XComponent, YComponent, ZComponent
format_7 = Format(Format="{0:R}", Culture=127, Data0=deconstruct_3.XComponent)
format_8 = Format(Format="{0:R}", Culture=127, Data0=deconstruct_3.YComponent)
scale_nu_3 = ScaleNU(
    Geometry=point_3,
    Plane=PlaneXY(0, 0, 0),
    ScaleX=expr("1/X", deconstruct_3.XComponent),
    ScaleY=expr("1/X", deconstruct_3.YComponent),
    ScaleZ=1)  # -> Geometry, Transform
interpolate_3 = Interpolate(Vertices=scale_nu_3.Geometry, Degree=3, Periodic=False, KnotStyle=2)  # -> Curve, Length, Domain
mirror = Mirror(Geometry=interpolate_3.Curve, Plane=Plane(origin=(0, 0.5, 0), x=(0, 0, 1), y=(1, 0, 0)))  # -> Geometry, Transform
scale_6 = Scale(Geometry=interpolate_3.Curve, Center=Point(0, 0, 0), Factor=power)  # -> Geometry, Transform
end_points_3 = EndPoints(Curve=scale_6.Geometry)  # -> Start, End
rectangle_2pt_3 = Rectangle2Pt(Plane=PlaneXY(0, 0, 0), PointA=end_points_3.Start, PointB=end_points_3.End, Radius=0)  # -> Rectangle, Length
curve_graph_mapper_3 = CurveGraphMapper(
    Curves=scale_6.Geometry,
    Rectangle=rectangle_2pt_3.Rectangle,
    Values=multiplication_3,
    XAxis=bounds_3,
    YAxis=bounds_3,
    Flip=False,
    Snap=False,
    TextSize=0.0625)  # -> Mapped, GraphCurves, GraphPoints, ValueLines, ValuePoints, MappedLines, MappedPoints, Boundary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; disabled
graphmapper_3 = GraphMapper(
    Curve=scale_6.Geometry,
    Boundary=rectangle_2pt_3.Rectangle,
    Numbers=multiplication_3,
    Input=bounds_3,
    Output=bounds_3,
    bobo=True)
division_14 = Division(A=graphmapper_3, B=power)
digit_scroller_16 = DigitScroller(Scroller_Digits=12, Scroller_Prefix="Digit Scroller", Scroller_Radix=2, Scroller_Value=0.0625)
division_15 = Division(A=pi_2, B=multiplication_5)
reverse_list_11 = ReverseList(List=division_14)
negative_4 = Negative(Value=reverse_list_11)
merge_8 = Merge(Data1=flatten(division_14), Data2=flatten("0"), Data3=flatten(negative_4))  # -> flatten(Result)
turtle_4 = DotNETVBScriptLEGACY(Forward=merge_5, Left=merge_8)  # -> Output, Points; inputs Forward: list, Left: list; same code as turtle
point_4 = Point(turtle_4.Points)
circle_fit_4 = CircleFit(Points=point_4)  # -> Circle, Radius, Deviation
area_4 = Area(Geometry=circle_fit_4.Circle)  # -> Area, Centroid
scale_7 = Scale(Geometry=circle_fit_4.Circle, Center=area_4.Centroid, Factor=expression_6)  # -> Geometry, Transform
panel_16 = Panel(circle_fit_4.Radius)
multiplication_9 = Multiplication(A=expression_6, B=circle_fit_4.Radius)
list_item_4 = ListItem(List=point_4, Index=-1, Wrap=True)
deconstruct_4 = Deconstruct(Point=list_item_4)  # -> XComponent, YComponent, ZComponent
format_9 = Format(Format="{0:R}", Culture=127, Data0=deconstruct_4.XComponent)
format_10 = Format(Format="{0:R}", Culture=127, Data0=deconstruct_4.YComponent)
scale_nu_4 = ScaleNU(
    Geometry=point_4,
    Plane=PlaneXY(0, 0, 0),
    ScaleX=expr("1/X", deconstruct_4.XComponent),
    ScaleY=expr("1/X", deconstruct_4.YComponent),
    ScaleZ=1)  # -> Geometry, Transform
interpolate_4 = Interpolate(Vertices=scale_nu_4.Geometry, Degree=3, Periodic=False, KnotStyle=2)  # -> Curve, Length, Domain
division_16 = Division(A=deconstruct_4.XComponent, B=deconstruct_4.YComponent)
format_11 = Format(Format="{0:R}", Culture=127, Data0=division_16)

panel_17 = Panel(format_11)
panel_18 = Panel(format_9)
panel_19 = Panel(format_10)

division_17 = Division(A=deconstruct_3.XComponent, B=deconstruct_3.YComponent)
format_12 = Format(Format="{0:R}", Culture=127, Data0=division_17)

panel_20 = Panel(format_7)
panel_21 = Panel(format_12)
panel_22 = Panel(format_8)

panel_23 = Panel(merge_7)
relative_differences = RelativeDifferences(Values=power_3)
panel_24 = Panel(merge_8)
digit_scroller_17 = DigitScroller(Scroller_Digits=12, Scroller_Prefix=" ", Scroller_Radix=11, Scroller_Value=0)
curve_edit_points = CurveEditPoints(Curve=interpolate.Curve, Knots=True)  # -> Points, Tangents, Parameters
xhg_ⵙ_ⵙ_ⵙᗝⵙꖴⵙ_ⵙᙏⵙᕤᕦⵙꖴⵙᔓᔕⵙ_ⵙиnⵙ_ⵙꖴⵙ_ⵙꖴⵙᔓᔕ = Curve(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)  # "XHG.⠀⠀⠀⠀ⵙ꞉ⵙ◯ⵙᗝⵙꖴⵙⓄⵙᙏⵙᕤᕦⵙꖴⵙᔓᔕⵙ◯ⵙИNⵙⓄⵙꖴⵙ✤ⵙꖴⵙᔓᔕⵙИNⵙᗩⵙᴥⵙ✤ⵙ◯ⵙꗳⵙᙁⵙᗱᗴⵙᔓᔕⵙ◯ⵙᙁⵙᗩⵙᗱᗴⵙᗝⵙꖴⵙ⠀⠀⠀⠀◯⠀⠀⠀⠀ⵙ⠀⠀⠀⠀◯⠀⠀⠀⠀ⵙꖴⵙᗝⵙᗱᗴⵙᗩⵙᙁⵙ◯ⵙᔓᔕⵙᗱᗴⵙᙁⵙꗳⵙ◯ⵙ✤ⵙᴥⵙᗩⵙИNⵙᔓᔕⵙꖴⵙ✤ⵙꖴⵙⓄⵙИNⵙ◯ⵙᔓᔕⵙꖴⵙᕤᕦⵙᙏⵙⓄⵙꖴⵙᗝⵙ◯ⵙ꞉ⵙ⠀⠀⠀⠀.GHX"
xhg_ⵙ_ⵙ_ⵙᗝⵙꖴⵙ_ⵙᙏⵙᕤᕦⵙꖴⵙᔓᔕⵙ_ⵙиnⵙ_ⵙꖴⵙ_ⵙꖴⵙᔓᔕ_2 = Curve(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)  # "XHG..⠀⠀⠀⠀ⵙ꞉ⵙ◯ⵙᗝⵙꖴⵙⓄⵙᙏⵙᕤᕦⵙꖴⵙᔓᔕⵙ◯ⵙИNⵙⓄⵙꖴⵙ✤ⵙꖴⵙᔓᔕⵙИNⵙᗩⵙᴥⵙ✤ⵙ◯ⵙꗳⵙᙁⵙᗱᗴⵙᔓᔕⵙ◯ⵙᙁⵙᗩⵙᗱᗴⵙᗝⵙꖴⵙ⠀⠀⠀⠀◯⠀⠀⠀⠀ⵙ⠀⠀⠀⠀◯⠀⠀⠀⠀ⵙꖴⵙᗝⵙᗱᗴⵙᗩⵙᙁⵙ◯ⵙᔓᔕⵙᗱᗴⵙᙁⵙꗳⵙ◯ⵙ✤ⵙᴥⵙᗩⵙИNⵙᔓᔕⵙꖴⵙ✤ⵙꖴⵙⓄⵙИNⵙ◯ⵙᔓᔕⵙꖴⵙᕤᕦⵙᙏⵙⓄⵙꖴⵙᗝⵙ◯ⵙ꞉ⵙ⠀⠀⠀⠀..GHX"
xhg_ⵙᔓᔕⵙᗱᗴⵙᴥⵙᑎⵙ_ⵙᗩⵙᗯⵙᴥⵙᑎⵙᑐᑕⵙ_ⵙᗝⵙᗱᗴⵙߦⵙᗩⵙᙏ = Curve(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)  # "XHG.⠀ⵙᔓᔕⵙᗱᗴⵙᴥⵙᑎⵙ✤ⵙᗩⵙᗯⵙᴥⵙᑎⵙᑐᑕⵙ◯ⵙᗝⵙᗱᗴⵙߦⵙᗩⵙᙏⵙ◯ⵙ∷ⵙ◯ⵙᔓᔕⵙᗝⵙꖴⵙⓄⵙᙏⵙᕤᕦⵙꖴⵙᔓᔕⵙ◯ⵙᗝⵙᗱᗴⵙᗯⵙꖴⵙᴥⵙᗱᗴⵙᗝⵙ◯ⵙᗱᗴⵙᴥⵙᑎⵙ✤ⵙᗩⵙᗯⵙᴥⵙᑎⵙᑐᑕⵙ◯ⵙᴥⵙᗩⵙᗱᗴⵙИNⵙꖴⵙᙁⵙ⠀◯⠀ⵙ⠀◯⠀ⵙᙁⵙꖴⵙИNⵙᗱᗴⵙᗩⵙᴥⵙ◯ⵙᑐᑕⵙᑎⵙᴥⵙᗯⵙᗩⵙ✤ⵙᑎⵙᴥⵙᗱᗴⵙ◯ⵙᗝⵙᗱᗴⵙᴥⵙꖴⵙᗯⵙᗱᗴⵙᗝⵙ◯ⵙᔓᔕⵙꖴⵙᕤᕦⵙᙏⵙⓄⵙꖴⵙᗝⵙᔓᔕⵙ◯ⵙ∷ⵙ◯ⵙᙏⵙᗩⵙߦⵙᗱᗴⵙᗝⵙ◯ⵙᑐᑕⵙᑎⵙᴥⵙᗯⵙᗩⵙ✤ⵙᑎⵙᴥⵙᗱᗴⵙᔓᔕⵙ⠀.GHX"
division_18 = Division(A=digit_scroller_6, B="1")
list_item_5 = ListItem(List=relative_differences, Index=1, Wrap=True)
curve_edit_points_2 = CurveEditPoints(Curve=interpolate_2.Curve, Knots=True)  # -> Points, Tangents, Parameters
division_19 = Division(A=digit_scroller_8, B="1")
stream_filter = StreamFilter(
    Gate=digit_scroller_17,
    Stream0=interpolate_4.Curve,
    Stream1=xhg_ⵙᔓᔕⵙᗱᗴⵙᴥⵙᑎⵙ_ⵙᗩⵙᗯⵙᴥⵙᑎⵙᑐᑕⵙ_ⵙᗝⵙᗱᗴⵙߦⵙᗩⵙᙏ,
    Stream2=xhg_ⵙ_ⵙ_ⵙᗝⵙꖴⵙ_ⵙᙏⵙᕤᕦⵙꖴⵙᔓᔕⵙ_ⵙиnⵙ_ⵙꖴⵙ_ⵙꖴⵙᔓᔕ,
    Stream3=xhg_ⵙ_ⵙ_ⵙᗝⵙꖴⵙ_ⵙᙏⵙᕤᕦⵙꖴⵙᔓᔕⵙ_ⵙиnⵙ_ⵙꖴⵙ_ⵙꖴⵙᔓᔕ_2)
list_length = ListLength(List=curve_edit_points.Points)  # -> expr("X-1", Length)
diference_curwature_shaped_graph = DIFERENCECURWATURESHAPEDGRAPH(
    B_2=digit_scroller_13,
    B_3=digit_scroller_13,
    B_4=digit_scroller_13,
    B_5=digit_scroller_13,
    B_6=digit_scroller_13,
    B_7=digit_scroller_13,
    B_8=digit_scroller_13,
    B_9=digit_scroller_13,
    B_10=digit_scroller_13,
    B_11=digit_scroller_13,
    B_12=digit_scroller_13,
    B_13=digit_scroller_13,
    B_14=digit_scroller_13,
    B_15=digit_scroller_13,
    B_16=digit_scroller_13,
    B_17=digit_scroller_13,
    B=digit_scroller_13,
    angle=0,
    count=list_length,
    curve=interpolate.Curve)  # -> relay_3, relay_4, relay_5, relay_6, relay_7, relay_8, relay_9, relay_10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; disabled
diference_curwature_linear_graph = DIFERENCECURWATURELINEARGRAPH(
    y_component=8,
    B=digit_scroller_13,
    y_component_2=7,
    B_2=digit_scroller_13,
    y_component_3=6,
    B_3=digit_scroller_13,
    y_component_4=5,
    B_4=digit_scroller_13,
    y_component_5=4,
    B_5=digit_scroller_13,
    y_component_6=3,
    B_6=digit_scroller_13,
    y_component_7=2,
    B_7=digit_scroller_13,
    y_component_8=1,
    B_8=digit_scroller_13,
    y_component_9=0,
    B_9=digit_scroller_13,
    count=list_length,
    curve=interpolate.Curve)  # disabled
diference_curwature_shaped_graph_2 = DIFERENCECURWATURESHAPEDGRAPH(
    B_2=digit_scroller_15,
    B_3=digit_scroller_15,
    B_4=digit_scroller_15,
    B_5=digit_scroller_15,
    B_6=digit_scroller_15,
    B_7=digit_scroller_15,
    B_8=digit_scroller_15,
    B_9=digit_scroller_15,
    B_10=digit_scroller_15,
    B_11=digit_scroller_15,
    B_12=digit_scroller_15,
    B_13=digit_scroller_15,
    B_14=digit_scroller_15,
    B_15=digit_scroller_15,
    B_16=digit_scroller_15,
    B_17=digit_scroller_15,
    B=digit_scroller_15,
    angle=0,
    count=division_18,
    curve=interpolate_3.Curve)  # -> relay_3, relay_4, relay_5, relay_6, relay_7, relay_8, relay_9, relay_10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
series_6 = Series(Start=0, Step=list_item_5, Count=expr("X+1", multiplication_5))
bounds_4 = Bounds(Numbers=series_6)
duplicate_data_5 = DuplicateData(Data=division_15, Number=multiplication_5, Order=True)
deconstruct_domain = DeconstructDomain(Domain=bounds_4)  # -> Start, End
list_length_2 = ListLength(List=curve_edit_points_2.Points)  # -> expr("X-1", Length)
diference_curwature_shaped_graph_3 = DIFERENCECURWATURESHAPEDGRAPH(
    B_2=digit_scroller_14,
    B_3=digit_scroller_14,
    B_4=digit_scroller_14,
    B_5=digit_scroller_14,
    B_6=digit_scroller_14,
    B_7=digit_scroller_14,
    B_8=digit_scroller_14,
    B_9=digit_scroller_14,
    B_10=digit_scroller_14,
    B_11=digit_scroller_14,
    B_12=digit_scroller_14,
    B_13=digit_scroller_14,
    B_14=digit_scroller_14,
    B_15=digit_scroller_14,
    B_16=digit_scroller_14,
    B_17=digit_scroller_14,
    B=digit_scroller_14,
    angle=0,
    count=list_length_2,
    curve=interpolate_2.Curve)  # -> relay_3, relay_4, relay_5, relay_6, relay_7, relay_8, relay_9, relay_10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; disabled
diference_curwature_linear_graph_2 = DIFERENCECURWATURELINEARGRAPH(
    y_component=8,
    y_component_2=7,
    y_component_3=6,
    y_component_4=5,
    y_component_5=4,
    y_component_6=3,
    y_component_7=2,
    y_component_8=1,
    y_component_9=0,
    count=list_length_2,
    curve=interpolate_2.Curve)  # disabled
curve_edit_points_3 = CurveEditPoints(Curve=stream_filter, Knots=True)  # -> Points, Tangents, Parameters
diference_curwature_linear_graph_3 = DIFERENCECURWATURELINEARGRAPH(
    y_component=8,
    y_component_2=7,
    y_component_3=6,
    y_component_4=5,
    y_component_5=4,
    y_component_6=3,
    y_component_7=2,
    y_component_8=1,
    y_component_9=0,
    count=digit_scroller_6,
    curve=interpolate_3.Curve)  # disabled
expression_13 = Expression(X=series_6, M=deconstruct_domain.End, N=digit_scroller_12, Expression="2/M-acos(cos(x*M/(4)^N))/pi/M*2")
turtle_5 = DotNETVBScriptLEGACY(Forward=duplicate_data_5, Left=expression_13)  # -> Output, Points; inputs Forward: list, Left: list; disabled
# ---------- turtle_5: VB ----------
    Dim i As Integer
    Dim dir As New On3dVector(1, 0, 0)
    Dim pos As New On3dVector(0, 0, 0)
    Dim axis As New On3dVector(0, 0, 1)
    Dim pnts As New List(Of On3dVector)

    pnts.Add(pos)

    For i = 0 To Forward.Count() - 1
      Dim P As New On3dVector
      dir.Rotate(Left(i), axis)
      P = dir * Forward(i) + pnts(i)
      pnts.Add(P)
    Next

    Points = pnts
# ---------- end turtle_5 ----------
panel_25 = Panel(series_6)
list_length_3 = ListLength(List=curve_edit_points_3.Points)  # -> expr("(X-1)/1", Length)
diference_curwature_shaped_graph_4 = DIFERENCECURWATURESHAPEDGRAPH(
    B_2=digit_scroller_16,
    B_3=digit_scroller_16,
    B_4=digit_scroller_16,
    B_5=digit_scroller_16,
    B_6=digit_scroller_16,
    B_7=digit_scroller_16,
    B_8=digit_scroller_16,
    B_9=digit_scroller_16,
    B_10=digit_scroller_16,
    B_11=digit_scroller_16,
    B_12=digit_scroller_16,
    B_13=digit_scroller_16,
    B_14=digit_scroller_16,
    B_15=digit_scroller_16,
    B_16=digit_scroller_16,
    B_17=digit_scroller_16,
    B=digit_scroller_16,
    angle=0,
    count=list_length_3,
    curve=stream_filter)  # -> relay_3, relay_4, relay_5, relay_6, relay_7, relay_8, relay_9, relay_10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
point_5 = Point(turtle_5.Points)
interpolate_5 = Interpolate(Vertices=point_5, Degree=1, Periodic=False, KnotStyle=1)  # -> Curve, Length, Domain
diference_curwature_linear_graph_4 = DIFERENCECURWATURELINEARGRAPH(
    y_component=8,
    B=digit_scroller_16,
    y_component_2=7,
    B_2=digit_scroller_16,
    y_component_3=6,
    B_3=digit_scroller_16,
    y_component_4=5,
    B_4=digit_scroller_16,
    y_component_5=4,
    B_5=digit_scroller_16,
    y_component_6=3,
    B_6=digit_scroller_16,
    y_component_7=2,
    B_7=digit_scroller_16,
    y_component_8=1,
    B_8=digit_scroller_16,
    y_component_9=0,
    B_9=digit_scroller_16,
    count=list_length_3,
    curve=stream_filter)
quick_graph = QuickGraph(expression_13, SortOrder=0)
panel_26 = Panel(expression_13)
panel_27 = Panel("""acos(cos(x*M/(4)/1))/pi/M*2
1/M-cos(x*M/4)/M*1

1/M-cos(x*M/(4)^N)/M
acos(cos(x*M/(4)^N))/pi/M*2

2/M-acos(cos(x*M/(4)^N))/pi/M*2""")

# ==== cluster DIFERENCECURWATURESHAPEDGRAPH
curve = ClusterInput()

digit_scroller = DigitScroller(Scroller_Digits=12, Scroller_Prefix=" ", Scroller_Radix=11, Scroller_Value=87)  # disabled
create_material = CreateMaterial(Diffuse=RGB(222, 222, 222), Specular=RGB(0, 255, 255), Emission=RGB(0, 0, 0), Transparency=0.5, Shine=100)
create_material_2 = CreateMaterial(Diffuse=RGB(247, 247, 247), Specular=RGB(0, 255, 255), Emission=RGB(0, 0, 0), Transparency=0.5, Shine=100)
create_material_3 = CreateMaterial(Diffuse=RGB(176, 176, 176), Specular=RGB(0, 255, 255), Emission=RGB(0, 0, 0), Transparency=0.5, Shine=100)
angle = ClusterInput()
curve_2 = Curve(graft(curve))
control_points = ControlPoints(Curve=curve_2)  # -> Points, Weights, Knots
list_length = ListLength(List=control_points.Points)  # -> expr("X-1", Length)
curve_degree = CurveDegree(Curve=curve_2)
expression = Expression(A=list_length, B=curve_degree, Expression="A-B+1")
length = Length(Curve=curve_2)
custom_preview = CustomPreview(Geometry=curve_2, Material=create_material_3)
count = ClusterInput()
divide_curve = DivideCurve(Curve=curve_2, Count=count, Kinks=False)  # -> Points, Tangents, Parameters
curvature = Curvature(Curve=curve_2, Parameter=divide_curve.Parameters)  # -> Point, Curvature, Curvature_2
deconstruct_arc = DeconstructArc(Arc=curvature.Curvature_2)  # -> BasePlane, Radius, Angle
line = Line(StartPoint=curvature.Point, EndPoint=deconstruct_arc.BasePlane)
one_over_x = OneOverX(Value=deconstruct_arc.Radius)
quick_graph = QuickGraph(one_over_x, SortOrder=0)
bounds = Bounds(Numbers=one_over_x)
relay = ClusterOutput(one_over_x)
remap_numbers = RemapNumbers(Value=one_over_x, Source=bounds, Target=Domain(0, 1))  # -> Mapped, Clipped
multiplication = Multiplication(A=length, B=remap_numbers.Mapped)
line_sdl = LineSDL(Start=divide_curve.Points, Direction=divide_curve.Tangents, Length=-1)
rotate = Rotate(Vector=curvature.Curvature, Axis=line_sdl, Angle=degrees(angle))
B = ClusterInput()
multiplication_2 = Multiplication(A=multiplication, B=B)
line_sdl_2 = LineSDL(Start=curvature.Point, Direction=rotate, Length=expr("-X", multiplication_2))
evaluate_length = EvaluateLength(Curve=line_sdl_2, Length=1, Normalized=True)  # -> Point, Tangent, Parameter
custom_preview_2 = CustomPreview(Geometry=line_sdl_2, Material=create_material_2)
number = Number(expression)
number_2 = Number(number)
curvature_graph = CurvatureGraph(Curve=curve_2, Density=1, Scale=digit_scroller)  # disabled
format = Format(Format="{0:R}", Culture=127, Data0=one_over_x)  # disabled
panel = Panel(format)
interpolate = Interpolate(Vertices=evaluate_length.Point, Degree=1, Periodic=False, KnotStyle=2)  # -> Curve, Length, Domain
curve_3 = Curve(interpolate.Curve)
custom_preview_3 = CustomPreview(Geometry=curve_3, Material=create_material)

explode = Explode(Curve=curve_3, Recursive=True)  # -> Segments, Vertices
evaluate_length_2 = EvaluateLength(Curve=explode.Segments, Length=0.5, Normalized=True)  # -> Point, Tangent, Parameter
curve_closest_point = CurveClosestPoint(Point=evaluate_length_2.Point, Curve=curve_2)  # -> Point, Parameter, Distance
line_2 = Line(StartPoint=curve_closest_point.Point, EndPoint=evaluate_length_2.Point)

replace_nulls = ReplaceNulls(Items=one_over_x, Replacements=0)  # -> Items, Count
relative_differences = RelativeDifferences(Values=replace_nulls.Items)
shift_list = ShiftList(List=relative_differences, Shift=1, Wrap=False)

replace_nulls_2 = ReplaceNulls(Items=shift_list, Replacements=0)  # -> Items, Count
relative_differences_2 = RelativeDifferences(Values=replace_nulls_2.Items)
shift_list_2 = ShiftList(List=relative_differences_2, Shift=1, Wrap=False)

replace_nulls_3 = ReplaceNulls(Items=shift_list_2, Replacements=0)  # -> Items, Count
relative_differences_3 = RelativeDifferences(Values=replace_nulls_3.Items)
shift_list_3 = ShiftList(List=relative_differences_3, Shift=1, Wrap=False)

replace_nulls_4 = ReplaceNulls(Items=shift_list_3, Replacements=0)  # -> Items, Count
relative_differences_4 = RelativeDifferences(Values=replace_nulls_4.Items)
shift_list_4 = ShiftList(List=relative_differences_4, Shift=1, Wrap=False)

replace_nulls_5 = ReplaceNulls(Items=shift_list_4, Replacements=0)  # -> Items, Count
relative_differences_5 = RelativeDifferences(Values=replace_nulls_5.Items)
shift_list_5 = ShiftList(List=relative_differences_5, Shift=1, Wrap=False)

expression_2 = Expression(O=shift_list_5, Expression="FORMAT(\"{0:R}\",O)")  # disabled
relay_2 = ClusterOutput(shift_list_5)
format_2 = Format(Format="{0:R}", Culture=127, Data0=shift_list_5)  # disabled
panel_2 = Panel(format_2)

replace_nulls_6 = ReplaceNulls(Items=shift_list_5, Replacements=0)  # -> Items, Count
relative_differences_6 = RelativeDifferences(Values=replace_nulls_6.Items)
shift_list_6 = ShiftList(List=relative_differences_6, Shift=1, Wrap=False)

replace_nulls_7 = ReplaceNulls(Items=shift_list_6, Replacements=0)  # -> Items, Count
relative_differences_7 = RelativeDifferences(Values=replace_nulls_7.Items)
shift_list_7 = ShiftList(List=relative_differences_7, Shift=1, Wrap=False)

replace_nulls_8 = ReplaceNulls(Items=shift_list_7, Replacements=0)  # -> Items, Count
relative_differences_8 = RelativeDifferences(Values=replace_nulls_8.Items)
shift_list_8 = ShiftList(List=relative_differences_8, Shift=1, Wrap=False)

replace_nulls_9 = ReplaceNulls(Items=shift_list_8, Replacements=0)  # -> Items, Count
relative_differences_9 = RelativeDifferences(Values=replace_nulls_9.Items)
shift_list_9 = ShiftList(List=relative_differences_9, Shift=1, Wrap=False)

replace_nulls_10 = ReplaceNulls(Items=shift_list_9, Replacements=0)  # -> Items, Count
relative_differences_10 = RelativeDifferences(Values=replace_nulls_10.Items)
shift_list_10 = ShiftList(List=relative_differences_10, Shift=1, Wrap=False)

replace_nulls_11 = ReplaceNulls(Items=shift_list_10, Replacements=0)  # -> Items, Count
relative_differences_11 = RelativeDifferences(Values=replace_nulls_11.Items)
shift_list_11 = ShiftList(List=relative_differences_11, Shift=1, Wrap=False)

replace_nulls_12 = ReplaceNulls(Items=shift_list_11, Replacements=0)  # -> Items, Count
relative_differences_12 = RelativeDifferences(Values=replace_nulls_12.Items)
shift_list_12 = ShiftList(List=relative_differences_12, Shift=1, Wrap=False)

replace_nulls_13 = ReplaceNulls(Items=shift_list_12, Replacements=0)  # -> Items, Count
relative_differences_13 = RelativeDifferences(Values=replace_nulls_13.Items)
shift_list_13 = ShiftList(List=relative_differences_13, Shift=1, Wrap=False)

replace_nulls_14 = ReplaceNulls(Items=shift_list_13, Replacements=0)  # -> Items, Count
relative_differences_14 = RelativeDifferences(Values=replace_nulls_14.Items)
shift_list_14 = ShiftList(List=relative_differences_14, Shift=1, Wrap=False)

replace_nulls_15 = ReplaceNulls(Items=shift_list_14, Replacements=0)  # -> Items, Count
relative_differences_15 = RelativeDifferences(Values=replace_nulls_15.Items)
shift_list_15 = ShiftList(List=relative_differences_15, Shift=1, Wrap=False)

replace_nulls_16 = ReplaceNulls(Items=shift_list_15, Replacements=0)  # -> Items, Count
relative_differences_16 = RelativeDifferences(Values=replace_nulls_16.Items)
shift_list_16 = ShiftList(List=relative_differences_16, Shift=1, Wrap=False)

bounds_2 = Bounds(Numbers=shift_list_16)
B_2 = ClusterInput()
remap_numbers_2 = RemapNumbers(Value=shift_list_16, Source=bounds_2, Target=Domain(-1, 1))  # -> Mapped, Clipped
multiplication_3 = Multiplication(A=length, B=remap_numbers_2.Mapped)
multiplication_4 = Multiplication(A=multiplication_3, B=B_2)

bounds_3 = Bounds(Numbers=shift_list_15)
B_3 = ClusterInput()
remap_numbers_3 = RemapNumbers(Value=shift_list_15, Source=bounds_3, Target=Domain(-1, 1))  # -> Mapped, Clipped
multiplication_5 = Multiplication(A=length, B=remap_numbers_3.Mapped)
multiplication_6 = Multiplication(A=multiplication_5, B=B_3)

bounds_4 = Bounds(Numbers=shift_list_14)
B_4 = ClusterInput()
remap_numbers_4 = RemapNumbers(Value=shift_list_14, Source=bounds_4, Target=Domain(-1, 1))  # -> Mapped, Clipped
multiplication_7 = Multiplication(A=length, B=remap_numbers_4.Mapped)
multiplication_8 = Multiplication(A=multiplication_7, B=B_4)

bounds_5 = Bounds(Numbers=shift_list_13)
B_5 = ClusterInput()
remap_numbers_5 = RemapNumbers(Value=shift_list_13, Source=bounds_5, Target=Domain(-1, 1))  # -> Mapped, Clipped
multiplication_9 = Multiplication(A=length, B=remap_numbers_5.Mapped)
multiplication_10 = Multiplication(A=multiplication_9, B=B_5)

bounds_6 = Bounds(Numbers=shift_list_12)
B_6 = ClusterInput()
remap_numbers_6 = RemapNumbers(Value=shift_list_12, Source=bounds_6, Target=Domain(-1, 1))  # -> Mapped, Clipped
multiplication_11 = Multiplication(A=length, B=remap_numbers_6.Mapped)
multiplication_12 = Multiplication(A=multiplication_11, B=B_6)

bounds_7 = Bounds(Numbers=shift_list_11)
B_7 = ClusterInput()
remap_numbers_7 = RemapNumbers(Value=shift_list_11, Source=bounds_7, Target=Domain(-1, 1))  # -> Mapped, Clipped
multiplication_13 = Multiplication(A=length, B=remap_numbers_7.Mapped)
multiplication_14 = Multiplication(A=multiplication_13, B=B_7)

bounds_8 = Bounds(Numbers=shift_list_10)
B_8 = ClusterInput()
remap_numbers_8 = RemapNumbers(Value=shift_list_10, Source=bounds_8, Target=Domain(-1, 1))  # -> Mapped, Clipped
multiplication_15 = Multiplication(A=length, B=remap_numbers_8.Mapped)
multiplication_16 = Multiplication(A=multiplication_15, B=B_8)

bounds_9 = Bounds(Numbers=shift_list_9)
B_9 = ClusterInput()
remap_numbers_9 = RemapNumbers(Value=shift_list_9, Source=bounds_9, Target=Domain(-1, 1))  # -> Mapped, Clipped
multiplication_17 = Multiplication(A=length, B=remap_numbers_9.Mapped)
multiplication_18 = Multiplication(A=multiplication_17, B=B_9)

bounds_10 = Bounds(Numbers=shift_list_8)
B_10 = ClusterInput()
remap_numbers_10 = RemapNumbers(Value=shift_list_8, Source=bounds_10, Target=Domain(-1, 1))  # -> Mapped, Clipped
multiplication_19 = Multiplication(A=length, B=remap_numbers_10.Mapped)
multiplication_20 = Multiplication(A=multiplication_19, B=B_10)

bounds_11 = Bounds(Numbers=shift_list_7)
B_11 = ClusterInput()
remap_numbers_11 = RemapNumbers(Value=shift_list_7, Source=bounds_11, Target=Domain(-1, 1))  # -> Mapped, Clipped
multiplication_21 = Multiplication(A=length, B=remap_numbers_11.Mapped)
multiplication_22 = Multiplication(A=multiplication_21, B=B_11)

bounds_12 = Bounds(Numbers=shift_list_6)
B_12 = ClusterInput()
remap_numbers_12 = RemapNumbers(Value=shift_list_6, Source=bounds_12, Target=Domain(-1, 1))  # -> Mapped, Clipped
multiplication_23 = Multiplication(A=length, B=remap_numbers_12.Mapped)
multiplication_24 = Multiplication(A=multiplication_23, B=B_12)

bounds_13 = Bounds(Numbers=shift_list_5)
B_13 = ClusterInput()
remap_numbers_13 = RemapNumbers(Value=shift_list_5, Source=bounds_13, Target=Domain(-1, 1))  # -> Mapped, Clipped
multiplication_25 = Multiplication(A=length, B=remap_numbers_13.Mapped)
multiplication_26 = Multiplication(A=multiplication_25, B=B_13)

bounds_14 = Bounds(Numbers=shift_list_4)
B_14 = ClusterInput()
remap_numbers_14 = RemapNumbers(Value=shift_list_4, Source=bounds_14, Target=Domain(-1, 1))  # -> Mapped, Clipped
multiplication_27 = Multiplication(A=length, B=remap_numbers_14.Mapped)
multiplication_28 = Multiplication(A=multiplication_27, B=B_14)

bounds_15 = Bounds(Numbers=shift_list_3)
B_15 = ClusterInput()
remap_numbers_15 = RemapNumbers(Value=shift_list_3, Source=bounds_15, Target=Domain(-1, 1))  # -> Mapped, Clipped
multiplication_29 = Multiplication(A=length, B=remap_numbers_15.Mapped)
multiplication_30 = Multiplication(A=multiplication_29, B=B_15)

bounds_16 = Bounds(Numbers=shift_list_2)
B_16 = ClusterInput()
remap_numbers_16 = RemapNumbers(Value=shift_list_2, Source=bounds_16, Target=Domain(-1, 1))  # -> Mapped, Clipped
multiplication_31 = Multiplication(A=length, B=remap_numbers_16.Mapped)
multiplication_32 = Multiplication(A=multiplication_31, B=B_16)

bounds_17 = Bounds(Numbers=shift_list)
B_17 = ClusterInput()
remap_numbers_17 = RemapNumbers(Value=shift_list, Source=bounds_17, Target=Domain(-1, 1))  # -> Mapped, Clipped
multiplication_33 = Multiplication(A=length, B=remap_numbers_17.Mapped)
multiplication_34 = Multiplication(A=multiplication_33, B=B_17)

quick_graph_2 = QuickGraph(shift_list, SortOrder=0)
create_material_4 = CreateMaterial(Diffuse=RGB(214, 214, 214), Specular=RGB(0, 255, 255), Emission=RGB(0, 0, 0), Transparency=0.5, Shine=100)
create_material_5 = CreateMaterial(Diffuse=RGB(240, 240, 240), Specular=RGB(0, 255, 255), Emission=RGB(0, 0, 0), Transparency=0.5, Shine=100)
line_sdl_3 = LineSDL(Start=evaluate_length_2.Point, Direction=line_2, Length=expr("ABS(X)", multiplication_34))
evaluate_length_3 = EvaluateLength(Curve=line_sdl_3, Length=1, Normalized=True)  # -> Point, Tangent, Parameter
custom_preview_4 = CustomPreview(Geometry=line_sdl_3, Material=create_material_5)
interpolate_2 = Interpolate(Vertices=evaluate_length_3.Point, Degree=1, Periodic=False, KnotStyle=2)  # -> Curve, Length, Domain
custom_preview_5 = CustomPreview(Geometry=interpolate_2.Curve, Material=create_material_4)

explode_2 = Explode(Curve=interpolate_2.Curve, Recursive=True)  # -> Segments, Vertices
evaluate_length_4 = EvaluateLength(Curve=explode_2.Segments, Length=0.5, Normalized=True)  # -> Point, Tangent, Parameter
curve_closest_point_2 = CurveClosestPoint(Point=evaluate_length_4.Point, Curve=curve_2)  # -> Point, Parameter, Distance
line_3 = Line(StartPoint=curve_closest_point_2.Point, EndPoint=evaluate_length_4.Point)

quick_graph_3 = QuickGraph(shift_list_2, SortOrder=0)
create_material_6 = CreateMaterial(Diffuse=RGB(207, 207, 207), Specular=RGB(0, 255, 255), Emission=RGB(0, 0, 0), Transparency=0.5, Shine=100)
create_material_7 = CreateMaterial(Diffuse=RGB(232, 232, 232), Specular=RGB(0, 255, 255), Emission=RGB(0, 0, 0), Transparency=0.5, Shine=100)
line_sdl_4 = LineSDL(Start=evaluate_length_4.Point, Direction=line_3, Length=expr("ABS(X)", multiplication_32))
evaluate_length_5 = EvaluateLength(Curve=line_sdl_4, Length=1, Normalized=True)  # -> Point, Tangent, Parameter
custom_preview_6 = CustomPreview(Geometry=line_sdl_4, Material=create_material_7)
interpolate_3 = Interpolate(Vertices=evaluate_length_5.Point, Degree=1, Periodic=False, KnotStyle=2)  # -> Curve, Length, Domain
custom_preview_7 = CustomPreview(Geometry=interpolate_3.Curve, Material=create_material_6)

explode_3 = Explode(Curve=interpolate_3.Curve, Recursive=True)  # -> Segments, Vertices
evaluate_length_6 = EvaluateLength(Curve=explode_3.Segments, Length=0.5, Normalized=True)  # -> Point, Tangent, Parameter
curve_closest_point_3 = CurveClosestPoint(Point=evaluate_length_6.Point, Curve=curve_2)  # -> Point, Parameter, Distance
line_4 = Line(StartPoint=curve_closest_point_3.Point, EndPoint=evaluate_length_6.Point)

quick_graph_4 = QuickGraph(shift_list_3, SortOrder=0)
create_material_8 = CreateMaterial(Diffuse=RGB(199, 199, 199), Specular=RGB(0, 255, 255), Emission=RGB(0, 0, 0), Transparency=0.5, Shine=100)
create_material_9 = CreateMaterial(Diffuse=RGB(224, 224, 224), Specular=RGB(0, 255, 255), Emission=RGB(0, 0, 0), Transparency=0.5, Shine=100)
line_sdl_5 = LineSDL(Start=evaluate_length_6.Point, Direction=line_4, Length=expr("ABS(X)", multiplication_30))
evaluate_length_7 = EvaluateLength(Curve=line_sdl_5, Length=1, Normalized=True)  # -> Point, Tangent, Parameter
custom_preview_8 = CustomPreview(Geometry=line_sdl_5, Material=create_material_9)
interpolate_4 = Interpolate(Vertices=evaluate_length_7.Point, Degree=1, Periodic=False, KnotStyle=2)  # -> Curve, Length, Domain
custom_preview_9 = CustomPreview(Geometry=interpolate_4.Curve, Material=create_material_8)

explode_4 = Explode(Curve=interpolate_4.Curve, Recursive=True)  # -> Segments, Vertices
evaluate_length_8 = EvaluateLength(Curve=explode_4.Segments, Length=0.5, Normalized=True)  # -> Point, Tangent, Parameter
curve_closest_point_4 = CurveClosestPoint(Point=evaluate_length_8.Point, Curve=curve_2)  # -> Point, Parameter, Distance
line_5 = Line(StartPoint=curve_closest_point_4.Point, EndPoint=evaluate_length_8.Point)

quick_graph_5 = QuickGraph(shift_list_4, SortOrder=0)
create_material_10 = CreateMaterial(Diffuse=RGB(191, 191, 191), Specular=RGB(0, 255, 255), Emission=RGB(0, 0, 0), Transparency=0.5, Shine=100)
create_material_11 = CreateMaterial(Diffuse=RGB(217, 217, 217), Specular=RGB(0, 255, 255), Emission=RGB(0, 0, 0), Transparency=0.5, Shine=100)
line_sdl_6 = LineSDL(Start=evaluate_length_8.Point, Direction=line_5, Length=expr("ABS(X)", multiplication_28))
evaluate_length_9 = EvaluateLength(Curve=line_sdl_6, Length=1, Normalized=True)  # -> Point, Tangent, Parameter
custom_preview_10 = CustomPreview(Geometry=line_sdl_6, Material=create_material_11)
interpolate_5 = Interpolate(Vertices=evaluate_length_9.Point, Degree=1, Periodic=False, KnotStyle=2)  # -> Curve, Length, Domain
custom_preview_11 = CustomPreview(Geometry=interpolate_5.Curve, Material=create_material_10)

explode_5 = Explode(Curve=interpolate_5.Curve, Recursive=True)  # -> Segments, Vertices
evaluate_length_10 = EvaluateLength(Curve=explode_5.Segments, Length=0.5, Normalized=True)  # -> Point, Tangent, Parameter
curve_closest_point_5 = CurveClosestPoint(Point=evaluate_length_10.Point, Curve=curve_2)  # -> Point, Parameter, Distance
line_6 = Line(StartPoint=curve_closest_point_5.Point, EndPoint=evaluate_length_10.Point)

quick_graph_6 = QuickGraph(shift_list_5, SortOrder=0)
create_material_12 = CreateMaterial(Diffuse=RGB(184, 184, 184), Specular=RGB(0, 255, 255), Emission=RGB(0, 0, 0), Transparency=0.5, Shine=100)
create_material_13 = CreateMaterial(Diffuse=RGB(209, 209, 209), Specular=RGB(0, 255, 255), Emission=RGB(0, 0, 0), Transparency=0.5, Shine=100)
line_sdl_7 = LineSDL(Start=evaluate_length_10.Point, Direction=line_6, Length=expr("ABS(X)", multiplication_26))
evaluate_length_11 = EvaluateLength(Curve=line_sdl_7, Length=1, Normalized=True)  # -> Point, Tangent, Parameter
custom_preview_12 = CustomPreview(Geometry=line_sdl_7, Material=create_material_13)
interpolate_6 = Interpolate(Vertices=evaluate_length_11.Point, Degree=1, Periodic=False, KnotStyle=2)  # -> Curve, Length, Domain
custom_preview_13 = CustomPreview(Geometry=interpolate_6.Curve, Material=create_material_12)

explode_6 = Explode(Curve=interpolate_6.Curve, Recursive=True)  # -> Segments, Vertices
evaluate_length_12 = EvaluateLength(Curve=explode_6.Segments, Length=0.5, Normalized=True)  # -> Point, Tangent, Parameter
curve_closest_point_6 = CurveClosestPoint(Point=evaluate_length_12.Point, Curve=curve_2)  # -> Point, Parameter, Distance
line_7 = Line(StartPoint=curve_closest_point_6.Point, EndPoint=evaluate_length_12.Point)

quick_graph_7 = QuickGraph(shift_list_6, SortOrder=0)
create_material_14 = CreateMaterial(Diffuse=RGB(176, 176, 176), Specular=RGB(0, 255, 255), Emission=RGB(0, 0, 0), Transparency=0.5, Shine=100)
create_material_15 = CreateMaterial(Diffuse=RGB(201, 201, 201), Specular=RGB(0, 255, 255), Emission=RGB(0, 0, 0), Transparency=0.5, Shine=100)
line_sdl_8 = LineSDL(Start=evaluate_length_12.Point, Direction=line_7, Length=expr("ABS(X)", multiplication_24))
evaluate_length_13 = EvaluateLength(Curve=line_sdl_8, Length=1, Normalized=True)  # -> Point, Tangent, Parameter
custom_preview_14 = CustomPreview(Geometry=line_sdl_8, Material=create_material_15)
interpolate_7 = Interpolate(Vertices=evaluate_length_13.Point, Degree=1, Periodic=False, KnotStyle=2)  # -> Curve, Length, Domain
custom_preview_15 = CustomPreview(Geometry=interpolate_7.Curve, Material=create_material_14)

explode_7 = Explode(Curve=interpolate_7.Curve, Recursive=True)  # -> Segments, Vertices
evaluate_length_14 = EvaluateLength(Curve=explode_7.Segments, Length=0.5, Normalized=True)  # -> Point, Tangent, Parameter
curve_closest_point_7 = CurveClosestPoint(Point=evaluate_length_14.Point, Curve=curve_2)  # -> Point, Parameter, Distance
line_8 = Line(StartPoint=curve_closest_point_7.Point, EndPoint=evaluate_length_14.Point)

quick_graph_8 = QuickGraph(shift_list_7, SortOrder=0)
create_material_16 = CreateMaterial(Diffuse=RGB(168, 168, 168), Specular=RGB(0, 255, 255), Emission=RGB(0, 0, 0), Transparency=0.5, Shine=100)
create_material_17 = CreateMaterial(Diffuse=RGB(194, 194, 194), Specular=RGB(0, 255, 255), Emission=RGB(0, 0, 0), Transparency=0.5, Shine=100)
line_sdl_9 = LineSDL(Start=evaluate_length_14.Point, Direction=line_8, Length=expr("ABS(X)", multiplication_22))
evaluate_length_15 = EvaluateLength(Curve=line_sdl_9, Length=1, Normalized=True)  # -> Point, Tangent, Parameter
custom_preview_16 = CustomPreview(Geometry=line_sdl_9, Material=create_material_17)
interpolate_8 = Interpolate(Vertices=evaluate_length_15.Point, Degree=1, Periodic=False, KnotStyle=2)  # -> Curve, Length, Domain
custom_preview_17 = CustomPreview(Geometry=interpolate_8.Curve, Material=create_material_16)

explode_8 = Explode(Curve=interpolate_8.Curve, Recursive=True)  # -> Segments, Vertices
evaluate_length_16 = EvaluateLength(Curve=explode_8.Segments, Length=0.5, Normalized=True)  # -> Point, Tangent, Parameter
curve_closest_point_8 = CurveClosestPoint(Point=evaluate_length_16.Point, Curve=curve_2)  # -> Point, Parameter, Distance
line_9 = Line(StartPoint=curve_closest_point_8.Point, EndPoint=evaluate_length_16.Point)

quick_graph_9 = QuickGraph(shift_list_8, SortOrder=0)
create_material_18 = CreateMaterial(Diffuse=RGB(161, 161, 161), Specular=RGB(0, 255, 255), Emission=RGB(0, 0, 0), Transparency=0.5, Shine=100)
create_material_19 = CreateMaterial(Diffuse=RGB(186, 186, 186), Specular=RGB(0, 255, 255), Emission=RGB(0, 0, 0), Transparency=0.5, Shine=100)
line_sdl_10 = LineSDL(Start=evaluate_length_16.Point, Direction=line_9, Length=expr("ABS(X)", multiplication_20))
evaluate_length_17 = EvaluateLength(Curve=line_sdl_10, Length=1, Normalized=True)  # -> Point, Tangent, Parameter
custom_preview_18 = CustomPreview(Geometry=line_sdl_10, Material=create_material_19)
interpolate_9 = Interpolate(Vertices=evaluate_length_17.Point, Degree=1, Periodic=False, KnotStyle=2)  # -> Curve, Length, Domain
custom_preview_19 = CustomPreview(Geometry=interpolate_9.Curve, Material=create_material_18)

explode_9 = Explode(Curve=interpolate_9.Curve, Recursive=True)  # -> Segments, Vertices
evaluate_length_18 = EvaluateLength(Curve=explode_9.Segments, Length=0.5, Normalized=True)  # -> Point, Tangent, Parameter
curve_closest_point_9 = CurveClosestPoint(Point=evaluate_length_18.Point, Curve=curve_2)  # -> Point, Parameter, Distance
line_10 = Line(StartPoint=curve_closest_point_9.Point, EndPoint=evaluate_length_18.Point)

quick_graph_10 = QuickGraph(shift_list_9, SortOrder=0)
create_material_20 = CreateMaterial(Diffuse=RGB(153, 153, 153), Specular=RGB(0, 255, 255), Emission=RGB(0, 0, 0), Transparency=0.5, Shine=100)
create_material_21 = CreateMaterial(Diffuse=RGB(178, 178, 178), Specular=RGB(0, 255, 255), Emission=RGB(0, 0, 0), Transparency=0.5, Shine=100)
line_sdl_11 = LineSDL(Start=evaluate_length_18.Point, Direction=line_10, Length=expr("ABS(X)", multiplication_18))
evaluate_length_19 = EvaluateLength(Curve=line_sdl_11, Length=1, Normalized=True)  # -> Point, Tangent, Parameter
custom_preview_20 = CustomPreview(Geometry=line_sdl_11, Material=create_material_21)
interpolate_10 = Interpolate(Vertices=evaluate_length_19.Point, Degree=1, Periodic=False, KnotStyle=2)  # -> Curve, Length, Domain
custom_preview_21 = CustomPreview(Geometry=interpolate_10.Curve, Material=create_material_20)

explode_10 = Explode(Curve=interpolate_10.Curve, Recursive=True)  # -> Segments, Vertices
evaluate_length_20 = EvaluateLength(Curve=explode_10.Segments, Length=0.5, Normalized=True)  # -> Point, Tangent, Parameter
curve_closest_point_10 = CurveClosestPoint(Point=evaluate_length_20.Point, Curve=curve_2)  # -> Point, Parameter, Distance
line_11 = Line(StartPoint=curve_closest_point_10.Point, EndPoint=evaluate_length_20.Point)

quick_graph_11 = QuickGraph(shift_list_10, SortOrder=0)
create_material_22 = CreateMaterial(Diffuse=RGB(145, 145, 145), Specular=RGB(0, 255, 255), Emission=RGB(0, 0, 0), Transparency=0.5, Shine=100)
create_material_23 = CreateMaterial(Diffuse=RGB(171, 171, 171), Specular=RGB(0, 255, 255), Emission=RGB(0, 0, 0), Transparency=0.5, Shine=100)
line_sdl_12 = LineSDL(Start=evaluate_length_20.Point, Direction=line_11, Length=expr("ABS(X)", multiplication_16))
evaluate_length_21 = EvaluateLength(Curve=line_sdl_12, Length=1, Normalized=True)  # -> Point, Tangent, Parameter
custom_preview_22 = CustomPreview(Geometry=line_sdl_12, Material=create_material_23)
interpolate_11 = Interpolate(Vertices=evaluate_length_21.Point, Degree=1, Periodic=False, KnotStyle=2)  # -> Curve, Length, Domain
custom_preview_23 = CustomPreview(Geometry=interpolate_11.Curve, Material=create_material_22)

explode_11 = Explode(Curve=interpolate_11.Curve, Recursive=True)  # -> Segments, Vertices
evaluate_length_22 = EvaluateLength(Curve=explode_11.Segments, Length=0.5, Normalized=True)  # -> Point, Tangent, Parameter
curve_closest_point_11 = CurveClosestPoint(Point=evaluate_length_22.Point, Curve=curve_2)  # -> Point, Parameter, Distance
line_12 = Line(StartPoint=curve_closest_point_11.Point, EndPoint=evaluate_length_22.Point)

quick_graph_12 = QuickGraph(shift_list_11, SortOrder=0)
create_material_24 = CreateMaterial(Diffuse=RGB(138, 138, 138), Specular=RGB(0, 255, 255), Emission=RGB(0, 0, 0), Transparency=0.5, Shine=100)
create_material_25 = CreateMaterial(Diffuse=RGB(163, 163, 163), Specular=RGB(0, 255, 255), Emission=RGB(0, 0, 0), Transparency=0.5, Shine=100)
line_sdl_13 = LineSDL(Start=evaluate_length_22.Point, Direction=line_12, Length=expr("ABS(X)", multiplication_14))
evaluate_length_23 = EvaluateLength(Curve=line_sdl_13, Length=1, Normalized=True)  # -> Point, Tangent, Parameter
custom_preview_24 = CustomPreview(Geometry=line_sdl_13, Material=create_material_25)
interpolate_12 = Interpolate(Vertices=evaluate_length_23.Point, Degree=1, Periodic=False, KnotStyle=2)  # -> Curve, Length, Domain
custom_preview_25 = CustomPreview(Geometry=interpolate_12.Curve, Material=create_material_24)

explode_12 = Explode(Curve=interpolate_12.Curve, Recursive=True)  # -> Segments, Vertices
evaluate_length_24 = EvaluateLength(Curve=explode_12.Segments, Length=0.5, Normalized=True)  # -> Point, Tangent, Parameter
curve_closest_point_12 = CurveClosestPoint(Point=evaluate_length_24.Point, Curve=curve_2)  # -> Point, Parameter, Distance
line_13 = Line(StartPoint=curve_closest_point_12.Point, EndPoint=evaluate_length_24.Point)

quick_graph_13 = QuickGraph(shift_list_12, SortOrder=0)
create_material_26 = CreateMaterial(Diffuse=RGB(130, 130, 130), Specular=RGB(0, 255, 255), Emission=RGB(0, 0, 0), Transparency=0.5, Shine=100)
create_material_27 = CreateMaterial(Diffuse=RGB(156, 156, 156), Specular=RGB(0, 255, 255), Emission=RGB(0, 0, 0), Transparency=0.5, Shine=100)
line_sdl_14 = LineSDL(Start=evaluate_length_24.Point, Direction=line_13, Length=expr("ABS(X)", multiplication_12))
evaluate_length_25 = EvaluateLength(Curve=line_sdl_14, Length=1, Normalized=True)  # -> Point, Tangent, Parameter
custom_preview_26 = CustomPreview(Geometry=line_sdl_14, Material=create_material_27)
interpolate_13 = Interpolate(Vertices=evaluate_length_25.Point, Degree=1, Periodic=False, KnotStyle=2)  # -> Curve, Length, Domain
custom_preview_27 = CustomPreview(Geometry=interpolate_13.Curve, Material=create_material_26)

explode_13 = Explode(Curve=interpolate_13.Curve, Recursive=True)  # -> Segments, Vertices
evaluate_length_26 = EvaluateLength(Curve=explode_13.Segments, Length=0.5, Normalized=True)  # -> Point, Tangent, Parameter
curve_closest_point_13 = CurveClosestPoint(Point=evaluate_length_26.Point, Curve=curve_2)  # -> Point, Parameter, Distance
line_14 = Line(StartPoint=curve_closest_point_13.Point, EndPoint=evaluate_length_26.Point)

quick_graph_14 = QuickGraph(shift_list_13, SortOrder=0)
create_material_28 = CreateMaterial(Diffuse=RGB(122, 122, 122), Specular=RGB(0, 255, 255), Emission=RGB(0, 0, 0), Transparency=0.5, Shine=100)
create_material_29 = CreateMaterial(Diffuse=RGB(148, 148, 148), Specular=RGB(0, 255, 255), Emission=RGB(0, 0, 0), Transparency=0.5, Shine=100)
line_sdl_15 = LineSDL(Start=evaluate_length_26.Point, Direction=line_14, Length=expr("ABS(X)", multiplication_10))
evaluate_length_27 = EvaluateLength(Curve=line_sdl_15, Length=1, Normalized=True)  # -> Point, Tangent, Parameter
custom_preview_28 = CustomPreview(Geometry=line_sdl_15, Material=create_material_29)
interpolate_14 = Interpolate(Vertices=evaluate_length_27.Point, Degree=1, Periodic=False, KnotStyle=2)  # -> Curve, Length, Domain
custom_preview_29 = CustomPreview(Geometry=interpolate_14.Curve, Material=create_material_28)

explode_14 = Explode(Curve=interpolate_14.Curve, Recursive=True)  # -> Segments, Vertices
evaluate_length_28 = EvaluateLength(Curve=explode_14.Segments, Length=0.5, Normalized=True)  # -> Point, Tangent, Parameter
curve_closest_point_14 = CurveClosestPoint(Point=evaluate_length_28.Point, Curve=curve_2)  # -> Point, Parameter, Distance
line_15 = Line(StartPoint=curve_closest_point_14.Point, EndPoint=evaluate_length_28.Point)

quick_graph_15 = QuickGraph(shift_list_14, SortOrder=0)
create_material_30 = CreateMaterial(Diffuse=RGB(115, 115, 115), Specular=RGB(0, 255, 255), Emission=RGB(0, 0, 0), Transparency=0.5, Shine=100)
create_material_31 = CreateMaterial(Diffuse=RGB(140, 140, 140), Specular=RGB(0, 255, 255), Emission=RGB(0, 0, 0), Transparency=0.5, Shine=100)
line_sdl_16 = LineSDL(Start=evaluate_length_28.Point, Direction=line_15, Length=expr("ABS(X)", multiplication_8))
evaluate_length_29 = EvaluateLength(Curve=line_sdl_16, Length=1, Normalized=True)  # -> Point, Tangent, Parameter
custom_preview_30 = CustomPreview(Geometry=line_sdl_16, Material=create_material_31)
interpolate_15 = Interpolate(Vertices=evaluate_length_29.Point, Degree=1, Periodic=False, KnotStyle=2)  # -> Curve, Length, Domain
custom_preview_31 = CustomPreview(Geometry=interpolate_15.Curve, Material=create_material_30)

explode_15 = Explode(Curve=interpolate_15.Curve, Recursive=True)  # -> Segments, Vertices
evaluate_length_30 = EvaluateLength(Curve=explode_15.Segments, Length=0.5, Normalized=True)  # -> Point, Tangent, Parameter
curve_closest_point_15 = CurveClosestPoint(Point=evaluate_length_30.Point, Curve=curve_2)  # -> Point, Parameter, Distance
line_16 = Line(StartPoint=curve_closest_point_15.Point, EndPoint=evaluate_length_30.Point)

quick_graph_16 = QuickGraph(shift_list_15, SortOrder=0)
create_material_32 = CreateMaterial(Diffuse=RGB(107, 107, 107), Specular=RGB(0, 255, 255), Emission=RGB(0, 0, 0), Transparency=0.5, Shine=100)
create_material_33 = CreateMaterial(Diffuse=RGB(133, 133, 133), Specular=RGB(0, 255, 255), Emission=RGB(0, 0, 0), Transparency=0.5, Shine=100)
line_sdl_17 = LineSDL(Start=evaluate_length_30.Point, Direction=line_16, Length=expr("ABS(X)", multiplication_6))
evaluate_length_31 = EvaluateLength(Curve=line_sdl_17, Length=1, Normalized=True)  # -> Point, Tangent, Parameter
custom_preview_32 = CustomPreview(Geometry=line_sdl_17, Material=create_material_33)
interpolate_16 = Interpolate(Vertices=evaluate_length_31.Point, Degree=1, Periodic=False, KnotStyle=2)  # -> Curve, Length, Domain
custom_preview_33 = CustomPreview(Geometry=interpolate_16.Curve, Material=create_material_32)

explode_16 = Explode(Curve=interpolate_16.Curve, Recursive=True)  # -> Segments, Vertices
evaluate_length_32 = EvaluateLength(Curve=explode_16.Segments, Length=0.5, Normalized=True)  # -> Point, Tangent, Parameter
curve_closest_point_16 = CurveClosestPoint(Point=evaluate_length_32.Point, Curve=curve_2)  # -> Point, Parameter, Distance
line_17 = Line(StartPoint=curve_closest_point_16.Point, EndPoint=evaluate_length_32.Point)

quick_graph_17 = QuickGraph(shift_list_16, SortOrder=0)
create_material_34 = CreateMaterial(Diffuse=RGB(99, 99, 99), Specular=RGB(0, 255, 255), Emission=RGB(0, 0, 0), Transparency=0.5, Shine=100)
create_material_35 = CreateMaterial(Diffuse=RGB(125, 125, 125), Specular=RGB(0, 255, 255), Emission=RGB(0, 0, 0), Transparency=0.5, Shine=100)
line_sdl_18 = LineSDL(Start=evaluate_length_32.Point, Direction=line_17, Length=expr("ABS(X)", multiplication_4))
evaluate_length_33 = EvaluateLength(Curve=line_sdl_18, Length=1, Normalized=True)  # -> Point, Tangent, Parameter
custom_preview_34 = CustomPreview(Geometry=line_sdl_18, Material=create_material_35)
interpolate_17 = Interpolate(Vertices=evaluate_length_33.Point, Degree=1, Periodic=False, KnotStyle=2)  # -> Curve, Length, Domain
custom_preview_35 = CustomPreview(Geometry=interpolate_17.Curve, Material=create_material_34)

relay_3 = ClusterOutput(shift_list_16)
format_3 = Format(Format="{0:R}", Culture=127, Data0=shift_list_16)  # disabled
panel_3 = Panel(format_3)

relay_4 = ClusterOutput(shift_list_15)
format_4 = Format(Format="{0:R}", Culture=127, Data0=shift_list_15)  # disabled
panel_4 = Panel(format_4)

relay_5 = ClusterOutput(shift_list_14)
format_5 = Format(Format="{0:R}", Culture=127, Data0=shift_list_14)  # disabled
panel_5 = Panel(format_5)

relay_6 = ClusterOutput(shift_list_13)
format_6 = Format(Format="{0:R}", Culture=127, Data0=shift_list_13)  # disabled
panel_6 = Panel(format_6)

relay_7 = ClusterOutput(shift_list_12)
format_7 = Format(Format="{0:R}", Culture=127, Data0=shift_list_12)  # disabled
panel_7 = Panel(format_7)

relay_8 = ClusterOutput(shift_list_11)
format_8 = Format(Format="{0:R}", Culture=127, Data0=shift_list_11)  # disabled
panel_8 = Panel(format_8)

relay_9 = ClusterOutput(shift_list_10)
format_9 = Format(Format="{0:R}", Culture=127, Data0=shift_list_10)  # disabled
panel_9 = Panel(format_9)

relay_10 = ClusterOutput(shift_list_9)
format_10 = Format(Format="{0:R}", Culture=127, Data0=shift_list_9)  # disabled
panel_10 = Panel(format_10)

relay_11 = ClusterOutput(shift_list_8)
format_11 = Format(Format="{0:R}", Culture=127, Data0=shift_list_8)  # disabled
panel_11 = Panel(format_11)

relay_12 = ClusterOutput(shift_list_7)
format_12 = Format(Format="{0:R}", Culture=127, Data0=shift_list_7)  # disabled
panel_12 = Panel(format_12)

relay_13 = ClusterOutput(shift_list_6)
format_13 = Format(Format="{0:R}", Culture=127, Data0=shift_list_6)  # disabled
panel_13 = Panel(format_13)

relay_14 = ClusterOutput(shift_list_4)
format_14 = Format(Format="{0:R}", Culture=127, Data0=shift_list_4)  # disabled
panel_14 = Panel(format_14)

relay_15 = ClusterOutput(shift_list_3)
format_15 = Format(Format="{0:R}", Culture=127, Data0=shift_list_3)  # disabled
panel_15 = Panel(format_15)

relay_16 = ClusterOutput(shift_list_2)
format_16 = Format(Format="{0:R}", Culture=127, Data0=shift_list_2)  # disabled
panel_16 = Panel(format_16)

relay_17 = ClusterOutput(shift_list)
format_17 = Format(Format="{0:R}", Culture=127, Data0=shift_list)  # disabled
panel_17 = Panel(format_17)

format_18 = Format(Format="{0:R}", Culture=127, Data0=deconstruct_arc.Radius)  # disabled
panel_18 = Panel(format_18)

# ==== cluster DIFERENCECURWATURELINEARGRAPH
y_component = ClusterInput()
y_component_2 = ClusterInput()
y_component_3 = ClusterInput()
y_component_4 = ClusterInput()
y_component_5 = ClusterInput()
y_component_6 = ClusterInput()
y_component_7 = ClusterInput()
y_component_8 = ClusterInput()
y_component_9 = ClusterInput()
B = ClusterInput()
B_2 = ClusterInput()
B_3 = ClusterInput()
B_4 = ClusterInput()
B_5 = ClusterInput()
B_6 = ClusterInput()
B_7 = ClusterInput()
B_8 = ClusterInput()
B_9 = ClusterInput()

create_material = CreateMaterial(Diffuse=RGB(161, 161, 161), Specular=RGB(0, 255, 255), Emission=RGB(0, 0, 0), Transparency=0.5, Shine=100)

create_material_2 = CreateMaterial(Diffuse=RGB(186, 186, 186), Specular=RGB(0, 255, 255), Emission=RGB(0, 0, 0), Transparency=0.5, Shine=100)

create_material_3 = CreateMaterial(Diffuse=RGB(168, 168, 168), Specular=RGB(0, 255, 255), Emission=RGB(0, 0, 0), Transparency=0.5, Shine=100)

create_material_4 = CreateMaterial(Diffuse=RGB(194, 194, 194), Specular=RGB(0, 255, 255), Emission=RGB(0, 0, 0), Transparency=0.5, Shine=100)

create_material_5 = CreateMaterial(Diffuse=RGB(176, 176, 176), Specular=RGB(0, 255, 255), Emission=RGB(0, 0, 0), Transparency=0.5, Shine=100)

create_material_6 = CreateMaterial(Diffuse=RGB(201, 201, 201), Specular=RGB(0, 255, 255), Emission=RGB(0, 0, 0), Transparency=0.5, Shine=100)

create_material_7 = CreateMaterial(Diffuse=RGB(184, 184, 184), Specular=RGB(0, 255, 255), Emission=RGB(0, 0, 0), Transparency=0.5, Shine=100)

create_material_8 = CreateMaterial(Diffuse=RGB(209, 209, 209), Specular=RGB(0, 255, 255), Emission=RGB(0, 0, 0), Transparency=0.5, Shine=100)

create_material_9 = CreateMaterial(Diffuse=RGB(191, 191, 191), Specular=RGB(0, 255, 255), Emission=RGB(0, 0, 0), Transparency=0.5, Shine=100)

create_material_10 = CreateMaterial(Diffuse=RGB(217, 217, 217), Specular=RGB(0, 255, 255), Emission=RGB(0, 0, 0), Transparency=0.5, Shine=100)

create_material_11 = CreateMaterial(Diffuse=RGB(199, 199, 199), Specular=RGB(0, 255, 255), Emission=RGB(0, 0, 0), Transparency=0.5, Shine=100)

create_material_12 = CreateMaterial(Diffuse=RGB(224, 224, 224), Specular=RGB(0, 255, 255), Emission=RGB(0, 0, 0), Transparency=0.5, Shine=100)

create_material_13 = CreateMaterial(Diffuse=RGB(207, 207, 207), Specular=RGB(0, 255, 255), Emission=RGB(0, 0, 0), Transparency=0.5, Shine=100)

create_material_14 = CreateMaterial(Diffuse=RGB(232, 232, 232), Specular=RGB(0, 255, 255), Emission=RGB(0, 0, 0), Transparency=0.5, Shine=100)

create_material_15 = CreateMaterial(Diffuse=RGB(214, 214, 214), Specular=RGB(0, 255, 255), Emission=RGB(0, 0, 0), Transparency=0.5, Shine=100)

create_material_16 = CreateMaterial(Diffuse=RGB(240, 240, 240), Specular=RGB(0, 255, 255), Emission=RGB(0, 0, 0), Transparency=0.5, Shine=100)

create_material_17 = CreateMaterial(Diffuse=RGB(222, 222, 222), Specular=RGB(0, 255, 255), Emission=RGB(0, 0, 0), Transparency=0.5, Shine=100)

create_material_18 = CreateMaterial(Diffuse=RGB(247, 247, 247), Specular=RGB(0, 255, 255), Emission=RGB(0, 0, 0), Transparency=0.5, Shine=100)

count = ClusterInput()
curve = ClusterInput()
curve_2 = Curve(graft(curve))
divide_curve = DivideCurve(Curve=curve_2, Count=count, Kinks=False)  # -> Points, Tangents, Parameters
curvature = Curvature(Curve=curve_2, Parameter=divide_curve.Parameters)  # -> Point, Curvature, Curvature_2
deconstruct_arc = DeconstructArc(Arc=curvature.Curvature_2)  # -> BasePlane, Radius, Angle
expression = Expression(O=deconstruct_arc.Radius, Expression="FORMAT(\"{0:R}\",O)")
panel = Panel(expression)
quick_graph = QuickGraph(deconstruct_arc.Radius, SortOrder=0)
curve_degree = CurveDegree(Curve=curve_2)
one_over_x = OneOverX(Value=deconstruct_arc.Radius)

expression_2 = Expression(O=one_over_x, Expression="FORMAT(\"{0:R}\",O)")
panel_2 = Panel(expression_2)

replace_nulls = ReplaceNulls(Items=one_over_x, Replacements=0)  # -> Items, Count
relative_differences = RelativeDifferences(Values=replace_nulls.Items)

control_points = ControlPoints(Curve=curve_2)  # -> Points, Weights, Knots
list_length = ListLength(List=control_points.Points)  # -> expr("X-1", Length)

expression_3 = Expression(O=relative_differences, Expression="FORMAT(\"{0:R}\",O)")
panel_3 = Panel(expression_3)
quick_graph_2 = QuickGraph(relative_differences, SortOrder=0)
multiplication = Multiplication(A=relative_differences, B=B_8)

quick_graph_3 = QuickGraph(one_over_x, SortOrder=0)
multiplication_2 = Multiplication(A=one_over_x, B=B_9)
line_sdl = LineSDL(Start=Point(0, 0, 0), Direction=Vector(1, 0, 0), Length=1)

replace_nulls_2 = ReplaceNulls(Items=relative_differences, Replacements=0)  # -> Items, Count
relative_differences_2 = RelativeDifferences(Values=replace_nulls_2.Items)
expression_4 = Expression(O=relative_differences_2, Expression="FORMAT(\"{0:R}\",O)")
panel_4 = Panel(expression_4)
quick_graph_4 = QuickGraph(relative_differences_2, SortOrder=0)
multiplication_3 = Multiplication(A=relative_differences_2, B=B_7)
line_sdl_2 = LineSDL(Start=Point(-2.121093912, 1.99985794, 0), Direction=Vector(0.0625, 0.0625, 0), Length=1)

replace_nulls_3 = ReplaceNulls(Items=relative_differences_2, Replacements=0)  # -> Items, Count
relative_differences_3 = RelativeDifferences(Values=replace_nulls_3.Items)
expression_5 = Expression(O=relative_differences_3, Expression="FORMAT(\"{0:R}\",O)")
panel_5 = Panel(expression_5)
quick_graph_5 = QuickGraph(relative_differences_3, SortOrder=0)
multiplication_4 = Multiplication(A=relative_differences_3, B=B_6)

replace_nulls_4 = ReplaceNulls(Items=relative_differences_3, Replacements=0)  # -> Items, Count
relative_differences_4 = RelativeDifferences(Values=replace_nulls_4.Items)
expression_6 = Expression(O=relative_differences_4, Expression="FORMAT(\"{0:R}\",O)")
panel_6 = Panel(expression_6)
quick_graph_6 = QuickGraph(relative_differences_4, SortOrder=0)
multiplication_5 = Multiplication(A=relative_differences_4, B=B_5)

replace_nulls_5 = ReplaceNulls(Items=relative_differences_4, Replacements=0)  # -> Items, Count
relative_differences_5 = RelativeDifferences(Values=replace_nulls_5.Items)
expression_7 = Expression(O=relative_differences_5, Expression="FORMAT(\"{0:R}\",O)")
panel_7 = Panel(expression_7)
quick_graph_7 = QuickGraph(relative_differences_5, SortOrder=0)
multiplication_6 = Multiplication(A=relative_differences_5, B=B_4)

replace_nulls_6 = ReplaceNulls(Items=relative_differences_5, Replacements=0)  # -> Items, Count
relative_differences_6 = RelativeDifferences(Values=replace_nulls_6.Items)

expression_8 = Expression(O=relative_differences_6, Expression="FORMAT(\"{0:R}\",O)")
panel_8 = Panel(expression_8)
quick_graph_8 = QuickGraph(relative_differences_6, SortOrder=0)
multiplication_7 = Multiplication(A=relative_differences_6, B=B_3)

replace_nulls_7 = ReplaceNulls(Items=relative_differences_6, Replacements=0)  # -> Items, Count
relative_differences_7 = RelativeDifferences(Values=replace_nulls_7.Items)
expression_9 = Expression(O=relative_differences_7, Expression="FORMAT(\"{0:R}\",O)")
panel_9 = Panel(expression_9)
quick_graph_9 = QuickGraph(relative_differences_7, SortOrder=0)
multiplication_8 = Multiplication(A=relative_differences_7, B=B_2)

replace_nulls_8 = ReplaceNulls(Items=relative_differences_7, Replacements=0)  # -> Items, Count
relative_differences_8 = RelativeDifferences(Values=replace_nulls_8.Items)
expression_10 = Expression(O=relative_differences_8, Expression="FORMAT(\"{0:R}\",O)")
panel_10 = Panel(expression_10)
quick_graph_10 = QuickGraph(relative_differences_8, SortOrder=0)
multiplication_9 = Multiplication(A=relative_differences_8, B=B)

expression_11 = Expression(A=list_length, B=curve_degree, Expression="A-B+1")
number = Number(expression_11)

divide_curve_2 = DivideCurve(Curve=line_sdl, Count=number, Kinks=False)  # -> Points, Tangents, Parameters
line_sdl_3 = LineSDL(Start=divide_curve_2.Points, Direction=Vector(0, 1, 0), Length=multiplication_2)

curve_3 = Curve(line_sdl_3)

list_length_2 = ListLength(List=curve_2)  # -> flatten(Length)
mass_addition = MassAddition(Input=list_length_2)  # -> Result, PartialResults
panel_11 = Panel(mass_addition.Result)
series = Series(Start=1, Step=1, Count=panel_11)  # -> graft(Series)
vector_xyz = VectorXYZ(XComponent=expr("-X", series), YComponent=y_component_9, ZComponent=0)  # -> Vector, Length
move = Move(Geometry=curve_3, Motion=vector_xyz.Vector)  # -> Geometry, Transform
evaluate_length = EvaluateLength(Curve=move.Geometry, Length=1, Normalized=True)  # -> Point, Tangent, Parameter
interpolate = Interpolate(Vertices=evaluate_length.Point, Degree=1, Periodic=False, KnotStyle=2)  # -> Curve, Length, Domain

vector_xyz_2 = VectorXYZ(XComponent=expr("-X", series), YComponent=y_component, ZComponent=0)  # -> Vector, Length
line_sdl_4 = LineSDL(Start=divide_curve_2.Points, Direction=Vector(0, 1, 0), Length=multiplication_9)
move_2 = Move(Geometry=line_sdl_4, Motion=vector_xyz_2.Vector)  # -> Geometry, Transform
evaluate_length_2 = EvaluateLength(Curve=move_2.Geometry, Length=1, Normalized=True)  # -> Point, Tangent, Parameter
interpolate_2 = Interpolate(Vertices=evaluate_length_2.Point, Degree=1, Periodic=False, KnotStyle=2)  # -> Curve, Length, Domain

vector_xyz_3 = VectorXYZ(XComponent=expr("-X", series), YComponent=y_component_2, ZComponent=0)  # -> Vector, Length
line_sdl_5 = LineSDL(Start=divide_curve_2.Points, Direction=Vector(0, 1, 0), Length=multiplication_8)
move_3 = Move(Geometry=line_sdl_5, Motion=vector_xyz_3.Vector)  # -> Geometry, Transform
evaluate_length_3 = EvaluateLength(Curve=move_3.Geometry, Length=1, Normalized=True)  # -> Point, Tangent, Parameter
interpolate_3 = Interpolate(Vertices=evaluate_length_3.Point, Degree=1, Periodic=False, KnotStyle=2)  # -> Curve, Length, Domain

vector_xyz_4 = VectorXYZ(XComponent=expr("-X", series), YComponent=y_component_3, ZComponent=0)  # -> Vector, Length
line_sdl_6 = LineSDL(Start=divide_curve_2.Points, Direction=Vector(0, 1, 0), Length=multiplication_7)
move_4 = Move(Geometry=line_sdl_6, Motion=vector_xyz_4.Vector)  # -> Geometry, Transform
evaluate_length_4 = EvaluateLength(Curve=move_4.Geometry, Length=1, Normalized=True)  # -> Point, Tangent, Parameter
interpolate_4 = Interpolate(Vertices=evaluate_length_4.Point, Degree=1, Periodic=False, KnotStyle=2)  # -> Curve, Length, Domain

vector_xyz_5 = VectorXYZ(XComponent=expr("-X", series), YComponent=y_component_4, ZComponent=0)  # -> Vector, Length
line_sdl_7 = LineSDL(Start=divide_curve_2.Points, Direction=Vector(0, 1, 0), Length=multiplication_6)
move_5 = Move(Geometry=line_sdl_7, Motion=vector_xyz_5.Vector)  # -> Geometry, Transform
evaluate_length_5 = EvaluateLength(Curve=move_5.Geometry, Length=1, Normalized=True)  # -> Point, Tangent, Parameter
interpolate_5 = Interpolate(Vertices=evaluate_length_5.Point, Degree=1, Periodic=False, KnotStyle=2)  # -> Curve, Length, Domain

vector_xyz_6 = VectorXYZ(XComponent=expr("-X", series), YComponent=y_component_5, ZComponent=0)  # -> Vector, Length
line_sdl_8 = LineSDL(Start=divide_curve_2.Points, Direction=Vector(0, 1, 0), Length=multiplication_5)
move_6 = Move(Geometry=line_sdl_8, Motion=vector_xyz_6.Vector)  # -> Geometry, Transform
evaluate_length_6 = EvaluateLength(Curve=move_6.Geometry, Length=1, Normalized=True)  # -> Point, Tangent, Parameter
interpolate_6 = Interpolate(Vertices=evaluate_length_6.Point, Degree=1, Periodic=False, KnotStyle=2)  # -> Curve, Length, Domain

vector_xyz_7 = VectorXYZ(XComponent=expr("-X", series), YComponent=y_component_6, ZComponent=0)  # -> Vector, Length
line_sdl_9 = LineSDL(Start=divide_curve_2.Points, Direction=Vector(0, 1, 0), Length=multiplication_4)
move_7 = Move(Geometry=line_sdl_9, Motion=vector_xyz_7.Vector)  # -> Geometry, Transform
evaluate_length_7 = EvaluateLength(Curve=move_7.Geometry, Length=1, Normalized=True)  # -> Point, Tangent, Parameter
interpolate_7 = Interpolate(Vertices=evaluate_length_7.Point, Degree=1, Periodic=False, KnotStyle=2)  # -> Curve, Length, Domain

vector_xyz_8 = VectorXYZ(XComponent=expr("-X", series), YComponent=y_component_7, ZComponent=0)  # -> Vector, Length
line_sdl_10 = LineSDL(Start=divide_curve_2.Points, Direction=Vector(0, 1, 0), Length=multiplication_3)
move_8 = Move(Geometry=line_sdl_10, Motion=vector_xyz_8.Vector)  # -> Geometry, Transform
evaluate_length_8 = EvaluateLength(Curve=move_8.Geometry, Length=1, Normalized=True)  # -> Point, Tangent, Parameter
interpolate_8 = Interpolate(Vertices=evaluate_length_8.Point, Degree=1, Periodic=False, KnotStyle=2)  # -> Curve, Length, Domain

vector_xyz_9 = VectorXYZ(XComponent=expr("-X", series), YComponent=y_component_8, ZComponent=0)  # -> Vector, Length
line_sdl_11 = LineSDL(Start=divide_curve_2.Points, Direction=Vector(0, 1, 0), Length=multiplication)
move_9 = Move(Geometry=line_sdl_11, Motion=vector_xyz_9.Vector)  # -> Geometry, Transform
evaluate_length_9 = EvaluateLength(Curve=move_9.Geometry, Length=1, Normalized=True)  # -> Point, Tangent, Parameter
interpolate_9 = Interpolate(Vertices=evaluate_length_9.Point, Degree=1, Periodic=False, KnotStyle=2)  # -> Curve, Length, Domain

custom_preview = CustomPreview(Geometry=interpolate_2.Curve, Material=create_material)

custom_preview_2 = CustomPreview(Geometry=move_2.Geometry, Material=create_material_2)

custom_preview_3 = CustomPreview(Geometry=interpolate_3.Curve, Material=create_material_3)

custom_preview_4 = CustomPreview(Geometry=move_3.Geometry, Material=create_material_4)

custom_preview_5 = CustomPreview(Geometry=interpolate_4.Curve, Material=create_material_5)

custom_preview_6 = CustomPreview(Geometry=move_4.Geometry, Material=create_material_6)

custom_preview_7 = CustomPreview(Geometry=interpolate_5.Curve, Material=create_material_7)

custom_preview_8 = CustomPreview(Geometry=move_5.Geometry, Material=create_material_8)

custom_preview_9 = CustomPreview(Geometry=interpolate_6.Curve, Material=create_material_9)

custom_preview_10 = CustomPreview(Geometry=move_6.Geometry, Material=create_material_10)

custom_preview_11 = CustomPreview(Geometry=interpolate_7.Curve, Material=create_material_11)

custom_preview_12 = CustomPreview(Geometry=move_7.Geometry, Material=create_material_12)

custom_preview_13 = CustomPreview(Geometry=interpolate_8.Curve, Material=create_material_13)

custom_preview_14 = CustomPreview(Geometry=move_8.Geometry, Material=create_material_14)

custom_preview_15 = CustomPreview(Geometry=interpolate_9.Curve, Material=create_material_15)

custom_preview_16 = CustomPreview(Geometry=move_9.Geometry, Material=create_material_16)

custom_preview_17 = CustomPreview(Geometry=interpolate.Curve, Material=create_material_17)

custom_preview_18 = CustomPreview(Geometry=move.Geometry, Material=create_material_18)
