# Grasshopper definition HG.XHG.⠀⠀⠀⠀ⵙᗝⵙꖴⵙⓄⵙᙏⵙᕤᕦⵙꖴⵙᔓᔕⵙ◯ⵙИNⵙⓄⵙꖴⵙ✤ⵙꖴⵙᔓᔕⵙИNⵙᗩⵙᴥⵙ✤ⵙ◯ⵙᙁⵙᗩⵙᗱᗴⵙᗝⵙꖴⵙ⠀⠀⠀⠀◯⠀⠀⠀⠀ⵙ⠀⠀⠀⠀◯⠀⠀⠀⠀ⵙꖴⵙᗝⵙᗱᗴⵙᗩⵙᙁⵙ◯ⵙ✤ⵙᴥⵙᗩⵙИNⵙᔓᔕⵙꖴⵙ✤ⵙꖴⵙⓄⵙИNⵙ◯ⵙᔓᔕⵙꖴⵙᕤᕦⵙᙏⵙⓄⵙꖴⵙᗝⵙ⠀⠀⠀⠀.GHX.GH (Grasshopper 1.0.7)

geometry = Geometry(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)
geometry_2 = Geometry([Line((0, -0.2499798173, 0), (0, -0.2499798173, 0)), Line((0.005079224614, -0.253080913, 0), (0.00509585239, -0.2550339672, 0)), Line((0.01026330305, -0.2591918831, 0), (0.01026330305, -0.2591918831, 0)), Line((0.01547809486, -0.2623781712, 0), (0.01552797323, -0.2643306592, 0)), Line((0.02070199413, -0.264177528, 0), (0.02070199413, -0.264177528, 0)), Line((0.02607665906, -0.2687333476, 0), (0.02615976758, -0.2706847036, 0))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])
geometry_3 = Geometry(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)
geometry_4 = Geometry([Line((0, -0.2499798173, 0), (0, -0.2499798173, 0)), Line((0.005062596839, -0.2511278588, 0), (0.005079224614, -0.253080913, 0)), Line((0.01019679352, -0.2552861994, 0), (0.01026330305, -0.2591918831, 0)), Line((0.01542821648, -0.2604256832, 0), (0.01547809486, -0.2623781712, 0)), Line((0.02070199413, -0.264177528, 0), (0.02070199413, -0.264177528, 0)), Line((0.02599355053, -0.2667819916, 0), (0.02607665906, -0.2687333476, 0))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])
geometry_5 = Geometry(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)
geometry_6 = Geometry([Line((0, -0.2499798173, 0), (0, -0.2499798173, 0)), Line((0.005055790794, -0.2503284389, 0), (0.005062596839, -0.2511278588, 0)), Line((0.01013028399, -0.2513805157, 0), (0.01019679352, -0.2552861994, 0)), Line((0.01524911909, -0.2534149192, 0), (0.01542821648, -0.2604256832, 0)), Line((0.0204360062, -0.2563695573, 0), (0.02070199413, -0.264177528, 0)), Line((0.02569513422, -0.2597752923, 0), (0.02599355053, -0.2667819916, 0))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])
geometry_7 = Geometry(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)
geometry_8 = Geometry([Line((0, -0.2499798173, 0), (0, -0.2499798173, 0)), Line((0.005054235623, -0.2501457726, 0), (0.005055790794, -0.2503284389, 0)), Line((0.01011667222, -0.2505811828, 0), (0.01013028399, -0.2513805157, 0)), Line((0.01519609724, -0.2513393799, 0), (0.01524911909, -0.2534149192, 0)), Line((0.02030301224, -0.2524655719, 0), (0.0204360062, -0.2563695573, 0)), Line((0.02545104637, -0.2540442043, 0), (0.02569513422, -0.2597752923, 0))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])
geometry_9 = Geometry(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)
geometry_10 = Geometry([Line((0, -0.2499798173, 0), (0, -0.2499798173, 0)), Line((0.005053474017, -0.2500563165, 0), (0.005054235623, -0.2501457726, 0)), Line((0.01011045168, -0.2502158899, 0), (0.01011667222, -0.2505811828, 0)), Line((0.0151743303, -0.2504873133, 0), (0.01519609724, -0.2513393799, 0)), Line((0.02024857544, -0.2508676013, 0), (0.02030301224, -0.2524655719, 0)), Line((0.02533703771, -0.2513673251, 0), (0.02545104637, -0.2540442043, 0))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])
geometry_11 = Geometry(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)
geometry_12 = Geometry([Line((0, -0.2499798173, 0), (0, -0.2499798173, 0)), Line((0.005053095166, -0.2500118176, 0), (0.005053474017, -0.2500563165, 0)), Line((0.01010740533, -0.250036997, 0), (0.01011045168, -0.2502158899, 0)), Line((0.01516396109, -0.2500814109, 0), (0.0151743303, -0.2504873133, 0)), Line((0.02022369798, -0.2501373332, 0), (0.02024857544, -0.2508676013, 0)), Line((0.02528767082, -0.2502082096, 0), (0.02533703771, -0.2513673251, 0))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])
geometry_13 = Geometry(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)
geometry_14 = Geometry([Line((0, -0.2499798173, 0), (0, -0.2499798173, 0)), Line((0.00505290599, -0.2499895975, 0), (0.005053095166, -0.2500118176, 0)), Line((0.01010588996, -0.249948009, 0), (0.01010740533, -0.250036997, 0)), Line((0.01515883611, -0.2498807938, 0), (0.01516396109, -0.2500814109, 0)), Line((0.02021151488, -0.249779703, 0), (0.02022369798, -0.2501373332, 0)), Line((0.02526378758, -0.2496474403, 0), (0.02528767082, -0.2502082096, 0))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])
geometry_15 = Geometry(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)
geometry_16 = Geometry([Line((0, -0.2499798173, 0), (0, -0.2499798173, 0)), Line((0.005052811436, -0.2499784914, 0), (0.00505290599, -0.2499895975, 0)), Line((0.01010513328, -0.2499035736, 0), (0.01010588996, -0.249948009, 0)), Line((0.01515628107, -0.2497807767, 0), (0.01515883611, -0.2498807938, 0)), Line((0.02020545455, -0.2496018045, 0), (0.02021151488, -0.249779703, 0)), Line((0.02525194133, -0.249369295, 0), (0.02526378758, -0.2496474403, 0))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])
geometry_17 = Geometry(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)
geometry_18 = Geometry([Line((0, 0, 0), (0, -0.2499798173, 0)), Line((0.002924456143, 1.244862148e-05, 0), (0.005052811436, -0.2499784914, 0)), Line((0.005848700316, 4.979448592e-05, 0), (0.01010513328, -0.2499035736, 0)), Line((0.008772504511, 0.0001120339187, 0), (0.01515628107, -0.2497807767, 0)), Line((0.01169568364, 0.0001991612387, 0), (0.02020545455, -0.2496018045, 0)), Line((0.01461801525, 0.0003111671633, 0), (0.02525194133, -0.249369295, 0))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])
geometry_19 = Geometry(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)

geometry_20 = Geometry(geometry_19)
evaluate_length = EvaluateLength(Curve=geometry_20, Length=1, Normalized=True)  # -> Point, Tangent, Parameter
yz_plane = YZPlane(Origin=evaluate_length.Point)
mirror = Mirror(Geometry=geometry_20, Plane=yz_plane)  # -> Geometry, Transform
geometry_21 = Geometry([geometry_20, mirror.Geometry])

geometry_22 = Geometry(geometry)
mirror_2 = Mirror(Geometry=geometry_22, Plane=yz_plane)  # -> Geometry, Transform
geometry_23 = Geometry([geometry_22, mirror_2.Geometry])

geometry_24 = Geometry(geometry_2)
mirror_3 = Mirror(Geometry=geometry_24, Plane=yz_plane)  # -> Geometry, Transform
geometry_25 = Geometry([geometry_24, mirror_3.Geometry])

geometry_26 = Geometry(geometry_3)
mirror_4 = Mirror(Geometry=geometry_26, Plane=yz_plane)  # -> Geometry, Transform
geometry_27 = Geometry([geometry_26, mirror_4.Geometry])

geometry_28 = Geometry(geometry_4)
mirror_5 = Mirror(Geometry=geometry_28, Plane=yz_plane)  # -> Geometry, Transform
geometry_29 = Geometry([geometry_28, mirror_5.Geometry])

geometry_30 = Geometry(geometry_5)
mirror_6 = Mirror(Geometry=geometry_30, Plane=yz_plane)  # -> Geometry, Transform
geometry_31 = Geometry([geometry_30, mirror_6.Geometry])

geometry_32 = Geometry(geometry_6)
mirror_7 = Mirror(Geometry=geometry_32, Plane=yz_plane)  # -> Geometry, Transform
geometry_33 = Geometry([geometry_32, mirror_7.Geometry])

geometry_34 = Geometry(geometry_7)
mirror_8 = Mirror(Geometry=geometry_34, Plane=yz_plane)  # -> Geometry, Transform
geometry_35 = Geometry([geometry_34, mirror_8.Geometry])

geometry_36 = Geometry(geometry_8)
mirror_9 = Mirror(Geometry=geometry_36, Plane=yz_plane)  # -> Geometry, Transform
geometry_37 = Geometry([geometry_36, mirror_9.Geometry])

geometry_38 = Geometry(geometry_9)
mirror_10 = Mirror(Geometry=geometry_38, Plane=yz_plane)  # -> Geometry, Transform
geometry_39 = Geometry([geometry_38, mirror_10.Geometry])

geometry_40 = Geometry(geometry_10)
mirror_11 = Mirror(Geometry=geometry_40, Plane=yz_plane)  # -> Geometry, Transform
geometry_41 = Geometry([geometry_40, mirror_11.Geometry])

geometry_42 = Geometry(geometry_11)
mirror_12 = Mirror(Geometry=geometry_42, Plane=yz_plane)  # -> Geometry, Transform
geometry_43 = Geometry([geometry_42, mirror_12.Geometry])

geometry_44 = Geometry(geometry_12)
mirror_13 = Mirror(Geometry=geometry_44, Plane=yz_plane)  # -> Geometry, Transform
geometry_45 = Geometry([geometry_44, mirror_13.Geometry])

geometry_46 = Geometry(geometry_13)
mirror_14 = Mirror(Geometry=geometry_46, Plane=yz_plane)  # -> Geometry, Transform
geometry_47 = Geometry([geometry_46, mirror_14.Geometry])

geometry_48 = Geometry(geometry_14)
mirror_15 = Mirror(Geometry=geometry_48, Plane=yz_plane)  # -> Geometry, Transform
geometry_49 = Geometry([geometry_48, mirror_15.Geometry])

geometry_50 = Geometry(geometry_15)
mirror_16 = Mirror(Geometry=geometry_50, Plane=yz_plane)  # -> Geometry, Transform
geometry_51 = Geometry([geometry_50, mirror_16.Geometry])

geometry_52 = Geometry(geometry_16)
mirror_17 = Mirror(Geometry=geometry_52, Plane=yz_plane)  # -> Geometry, Transform
geometry_53 = Geometry([geometry_52, mirror_17.Geometry])

geometry_54 = Geometry(geometry_17)
mirror_18 = Mirror(Geometry=geometry_54, Plane=yz_plane)  # -> Geometry, Transform
geometry_55 = Geometry([geometry_54, mirror_18.Geometry])

geometry_56 = Geometry(geometry_18)
mirror_19 = Mirror(Geometry=geometry_56, Plane=yz_plane)  # -> Geometry, Transform
geometry_57 = Geometry([geometry_56, mirror_19.Geometry])

colour_picker = ColourPicker(PickedColour=RGB(240, 240, 240))
create_material = CreateMaterial(Diffuse=colour_picker, Specular=RGB(255, 255, 255), Emission=RGB(0, 0, 0), Transparency=0, Shine=0)
custom_preview = CustomPreview(Geometry=geometry_53, Material=create_material)

colour_picker_2 = ColourPicker(PickedColour=RGB(161, 161, 161))
create_material_2 = CreateMaterial(Diffuse=colour_picker_2, Specular=RGB(255, 255, 255), Emission=RGB(0, 0, 0), Transparency=0, Shine=0)
custom_preview_2 = CustomPreview(Geometry=geometry_23, Material=create_material_2)

colour_picker_3 = ColourPicker(PickedColour=RGB(186, 186, 186))
create_material_3 = CreateMaterial(Diffuse=colour_picker_3, Specular=RGB(255, 255, 255), Emission=RGB(0, 0, 0), Transparency=0, Shine=0)
custom_preview_3 = CustomPreview(Geometry=geometry_25, Material=create_material_3)

colour_picker_4 = ColourPicker(PickedColour=RGB(168, 168, 168))
create_material_4 = CreateMaterial(Diffuse=colour_picker_4, Specular=RGB(255, 255, 255), Emission=RGB(0, 0, 0), Transparency=0, Shine=0)
custom_preview_4 = CustomPreview(Geometry=geometry_27, Material=create_material_4)

colour_picker_5 = ColourPicker(PickedColour=RGB(194, 194, 194))
create_material_5 = CreateMaterial(Diffuse=colour_picker_5, Specular=RGB(255, 255, 255), Emission=RGB(0, 0, 0), Transparency=0, Shine=0)
custom_preview_5 = CustomPreview(Geometry=geometry_29, Material=create_material_5)

colour_picker_6 = ColourPicker(PickedColour=RGB(176, 176, 176))
create_material_6 = CreateMaterial(Diffuse=colour_picker_6, Specular=RGB(255, 255, 255), Emission=RGB(0, 0, 0), Transparency=0, Shine=0)
custom_preview_6 = CustomPreview(Geometry=geometry_31, Material=create_material_6)

colour_picker_7 = ColourPicker(PickedColour=RGB(201, 201, 201))
create_material_7 = CreateMaterial(Diffuse=colour_picker_7, Specular=RGB(255, 255, 255), Emission=RGB(0, 0, 0), Transparency=0, Shine=0)
custom_preview_7 = CustomPreview(Geometry=geometry_33, Material=create_material_7)

colour_picker_8 = ColourPicker(PickedColour=RGB(184, 184, 184))
create_material_8 = CreateMaterial(Diffuse=colour_picker_8, Specular=RGB(255, 255, 255), Emission=RGB(0, 0, 0), Transparency=0, Shine=0)
custom_preview_8 = CustomPreview(Geometry=geometry_35, Material=create_material_8)

colour_picker_9 = ColourPicker(PickedColour=RGB(209, 209, 209))
create_material_9 = CreateMaterial(Diffuse=colour_picker_9, Specular=RGB(255, 255, 255), Emission=RGB(0, 0, 0), Transparency=0, Shine=0)
custom_preview_9 = CustomPreview(Geometry=geometry_37, Material=create_material_9)

colour_picker_10 = ColourPicker(PickedColour=RGB(191, 191, 191))
create_material_10 = CreateMaterial(Diffuse=colour_picker_10, Specular=RGB(255, 255, 255), Emission=RGB(0, 0, 0), Transparency=0, Shine=0)
custom_preview_10 = CustomPreview(Geometry=geometry_39, Material=create_material_10)

colour_picker_11 = ColourPicker(PickedColour=RGB(217, 217, 217))
create_material_11 = CreateMaterial(Diffuse=colour_picker_11, Specular=RGB(255, 255, 255), Emission=RGB(0, 0, 0), Transparency=0, Shine=0)
custom_preview_11 = CustomPreview(Geometry=geometry_41, Material=create_material_11)

colour_picker_12 = ColourPicker(PickedColour=RGB(199, 199, 199))
create_material_12 = CreateMaterial(Diffuse=colour_picker_12, Specular=RGB(255, 255, 255), Emission=RGB(0, 0, 0), Transparency=0, Shine=0)
custom_preview_12 = CustomPreview(Geometry=geometry_43, Material=create_material_12)

colour_picker_13 = ColourPicker(PickedColour=RGB(224, 224, 224))
create_material_13 = CreateMaterial(Diffuse=colour_picker_13, Specular=RGB(255, 255, 255), Emission=RGB(0, 0, 0), Transparency=0, Shine=0)
custom_preview_13 = CustomPreview(Geometry=geometry_45, Material=create_material_13)

colour_picker_14 = ColourPicker(PickedColour=RGB(207, 207, 207))
create_material_14 = CreateMaterial(Diffuse=colour_picker_14, Specular=RGB(255, 255, 255), Emission=RGB(0, 0, 0), Transparency=0, Shine=0)
custom_preview_14 = CustomPreview(Geometry=geometry_47, Material=create_material_14)

colour_picker_15 = ColourPicker(PickedColour=RGB(232, 232, 232))
create_material_15 = CreateMaterial(Diffuse=colour_picker_15, Specular=RGB(255, 255, 255), Emission=RGB(0, 0, 0), Transparency=0, Shine=0)
custom_preview_15 = CustomPreview(Geometry=geometry_49, Material=create_material_15)

colour_picker_16 = ColourPicker(PickedColour=RGB(214, 214, 214))
create_material_16 = CreateMaterial(Diffuse=colour_picker_16, Specular=RGB(255, 255, 255), Emission=RGB(0, 0, 0), Transparency=0, Shine=0)
custom_preview_16 = CustomPreview(Geometry=geometry_51, Material=create_material_16)

colour_picker_17 = ColourPicker(PickedColour=RGB(222, 222, 222))
create_material_17 = CreateMaterial(Diffuse=colour_picker_17, Specular=RGB(255, 255, 255), Emission=RGB(0, 0, 0), Transparency=0, Shine=0)
custom_preview_17 = CustomPreview(Geometry=geometry_55, Material=create_material_17)

colour_picker_18 = ColourPicker(PickedColour=RGB(247, 247, 247))
create_material_18 = CreateMaterial(Diffuse=colour_picker_18, Specular=RGB(255, 255, 255), Emission=RGB(0, 0, 0), Transparency=0, Shine=0)
custom_preview_18 = CustomPreview(Geometry=geometry_57, Material=create_material_18)

colour_picker_19 = ColourPicker(PickedColour=RGB(176, 176, 176))
create_material_19 = CreateMaterial(Diffuse=colour_picker_19, Specular=RGB(255, 255, 255), Emission=RGB(0, 0, 0), Transparency=0, Shine=0)
custom_preview_19 = CustomPreview(Geometry=geometry_21, Material=create_material_19)

merge = Merge(
    Data1=geometry_21,
    Data2=geometry_57,
    Data3=geometry_55,
    Data4=geometry_53,
    Data5=geometry_51,
    Data6=geometry_49,
    Data7=geometry_47,
    Data8=geometry_45,
    Data9=geometry_43,
    Data10=geometry_41,
    Data11=geometry_39,
    Data12=geometry_37,
    Data13=geometry_35,
    Data14=geometry_33,
    Data15=geometry_31,
    Data16=geometry_29,
    Data17=geometry_27,
    Data18=geometry_25,
    Data19=geometry_23)
