# Grasshopper definition XHG.⚪ᴥ⚪ᗱᗴ⚪ИN⚪ᴥ⚪Ⓞ⚪ᑐᑕ⚪◯⚪✤⚪옷⚪ᕤᕦ⚪ꖴ⚪ᗩ⚪ᴥ⚪✤⚪ᔓᔕ⚪◯⚪ᗱᗴ⚪ᗯ⚪ᴥ⚪ᑎ⚪ᑐᑕ⚪◯⚪ᕤᕦ⚪ИN⚪ꖴ⚪ИN⚪Ⓞ⚪ꖴ⚪✤⚪ꖴ⚪ᔓᔕ⚪ИN⚪ᗩ◯ᴥ⚪✤⚪◯⚪ꗳ⚪ᙁ⚪ᗱᗴ⚪ᔓᔕ⚪◌⚪◌⚪◌⚪◌⚪◌⚪◌⚪ᔓᔕ⚪ᗱᗴ⚪ᙁ⚪ꗳ⚪◯⚪✤⚪ᴥ◯ᗩ⚪ИN⚪ᔓᔕ⚪ꖴ⚪✤⚪ꖴ⚪Ⓞ⚪ИN⚪ꖴ⚪ИN⚪ᕤᕦ⚪◯⚪ᑐᑕ⚪ᑎ⚪ᴥ⚪ᗯ⚪ᗱᗴ⚪◯⚪ᔓᔕ⚪✤⚪ᴥ⚪ᗩ⚪ꖴ⚪ᕤᕦ⚪옷⚪✤⚪◯⚪ᑐᑕ⚪Ⓞ⚪ᴥ⚪ИN⚪ᗱᗴ⚪ᴥ⚪.GHX (Grasshopper 1.0.7)
# plug-ins: Anemone, Heteroptera, Pancake, CurvePlus, Pufferfish, LunchBox

data = Data("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")
data_2 = Data("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")  # disabled
data_3 = Data("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")  # disabled
data_4 = Data("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")  # disabled
data_5 = Data("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")  # disabled
data_6 = Data("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")  # disabled
data_7 = Data("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")  # disabled
read_file = ReadFile(File="C:\FABIUS 2048 X.TXT", PerLineParse=True)  # disabled
read_file_2 = ReadFile(File="C:\FABIUS 16384 X.TXT", PerLineParse=True)  # disabled
read_file_3 = ReadFile(File="C:\FABIUS 2048 Y.TXT", PerLineParse=True)  # disabled
read_file_4 = ReadFile(File="C:\FABIUS 4096 X.TXT", PerLineParse=True)  # disabled
read_file_5 = ReadFile(File="C:\FABIUS 16384 Y.TXT", PerLineParse=True)  # disabled
read_file_6 = ReadFile(File="C:\FABIUS 4096 Y.TXT", PerLineParse=True)  # disabled
y_1024 = Panel("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")
x_1024 = Panel("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")
y_128 = Panel("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")  # disabled
x_128 = Panel("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")  # disabled
panel = Panel("0.0003419868677042794559")
panel_2 = Panel("0.0003419868677042794559/3*4")
curve = Curve(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)  # disabled
curve_2 = Curve(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)  # disabled
curve_3 = Curve(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)  # disabled
curve_4 = Curve(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)  # disabled
curve_5 = Curve(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)  # disabled
curve_6 = Curve(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)  # disabled
curve_7 = Curve(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)  # disabled
curve_8 = Curve(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)  # disabled
text_split = TextSplit(Text=x_1024, Separators=",")
text_split_2 = TextSplit(Text=data, Separators=",")
text_split_3 = TextSplit(Text=y_128, Separators=",")  # disabled
text_split_4 = TextSplit(Text=x_128, Separators=",")  # disabled
text_split_5 = TextSplit(Text=data_3, Separators=",")  # disabled
text_split_6 = TextSplit(Text=data_2, Separators=",")  # disabled
text_split_7 = TextSplit(Text=data_7, Separators=",")  # disabled
text_split_8 = TextSplit(Text=data_6, Separators=",")  # disabled
text_split_9 = TextSplit(Text=data_4, Separators=",")  # disabled
text_split_10 = TextSplit(Text=data_5, Separators=",")  # disabled
turn_step = DigitScroller(Scroller_Digits=12, Scroller_Prefix="TURN STEP", Scroller_Radix=2, Scroller_Value=8.2958e-06)
turn_step_2 = DigitScroller(Scroller_Digits=12, Scroller_Prefix="TURN STEP", Scroller_Radix=2, Scroller_Value=8.2958e-06)
panel_9 = Panel("0.00000829580614590183683")
panel_10 = Panel("0.00000829580614590183683")
concatenate = Concatenate(FragmentA=text_split, FragmentB="*65536")
segment_number = DigitScroller(Scroller_Digits=12, Scroller_Prefix="SEGMENT NUMBER", Scroller_Radix=11, Scroller_Value=1024)
concatenate_2 = Concatenate(FragmentA=text_split_4, FragmentB="*65536")  # disabled
segment_number_2 = DigitScroller(Scroller_Digits=12, Scroller_Prefix="SEGMENT NUMBER", Scroller_Radix=11, Scroller_Value=1024)
concatenate_3 = Concatenate(FragmentA=text_split_2, FragmentB="*65536")
concatenate_4 = Concatenate(FragmentA=text_split_3, FragmentB="*65536")  # disabled
turn_step_3 = DigitScroller(Scroller_Digits=12, Scroller_Prefix="TURN STEP", Scroller_Radix=2, Scroller_Value=8.3878e-06)
panel_11 = Panel("0.00000827464986723083945")
number = Number(expr("DEG(X)", panel_9))
turn_step_4 = DigitScroller(Scroller_Digits=12, Scroller_Prefix="TURN STEP", Scroller_Radix=2, Scroller_Value=0.0005089518)
concatenate_5 = Concatenate(FragmentA=text_split_6, FragmentB="*65536")  # disabled
number_2 = Number(expr("DEG(X)", panel_10))
panel_12 = Panel("0.00000888288626276585293")
concatenate_6 = Concatenate(FragmentA=text_split_5, FragmentB="*65536")  # disabled
panel_13 = Panel(text_split_2)
concatenate_7 = Concatenate(FragmentA=text_split_9, FragmentB="*65536")  # disabled
segment_number_3 = DigitScroller(Scroller_Digits=12, Scroller_Prefix="SEGMENT NUMBER", Scroller_Radix=11, Scroller_Value=1024)
concatenate_8 = Concatenate(FragmentA=text_split_10, FragmentB="*65536")  # disabled
concatenate_9 = Concatenate(FragmentA=text_split_7, FragmentB="*65536")  # disabled
concatenate_10 = Concatenate(FragmentA=text_split_8, FragmentB="*65536")  # disabled
segment_number_4 = DigitScroller(Scroller_Digits=12, Scroller_Prefix="SEGMENT NUMBER", Scroller_Radix=11, Scroller_Value=1024)
panel_14 = Panel(text_split_5)  # disabled
number_3 = Number(expr("DEG(X)", panel_11))
panel_15 = Panel(text_split_7)  # disabled
panel_16 = Panel(text_split_8)  # disabled
number_4 = Number(expr("DEG(X)", panel_12))
subtraction = Subtraction(A=segment_number, B=2)
multiplication = Multiplication(A=subtraction, B=2)
subtraction_2 = Subtraction(A=segment_number_2, B=2)
multiplication_2 = Multiplication(A=subtraction_2, B=2)

construct_point = ConstructPoint(XCoordinate=concatenate, YCoordinate=concatenate_3, ZCoordinate=0)
construct_point_2 = ConstructPoint(XCoordinate=text_split, YCoordinate=text_split_2, ZCoordinate=0)

construct_point_3 = ConstructPoint(XCoordinate=concatenate_2, YCoordinate=concatenate_4, ZCoordinate=0)  # disabled
construct_point_4 = ConstructPoint(XCoordinate=text_split_4, YCoordinate=text_split_3, ZCoordinate=0)  # disabled

subtraction_3 = Subtraction(A=segment_number_3, B=2)
multiplication_3 = Multiplication(A=subtraction_3, B=2)

construct_point_5 = ConstructPoint(XCoordinate=concatenate_5, YCoordinate=concatenate_6, ZCoordinate=0)  # disabled
construct_point_6 = ConstructPoint(XCoordinate=text_split_6, YCoordinate=text_split_5, ZCoordinate=0)  # disabled

subtraction_4 = Subtraction(A=segment_number_4, B=2)
multiplication_4 = Multiplication(A=subtraction_4, B=2)

construct_point_7 = ConstructPoint(XCoordinate=concatenate_7, YCoordinate=concatenate_9, ZCoordinate=0)  # disabled
construct_point_8 = ConstructPoint(XCoordinate=text_split_9, YCoordinate=text_split_7, ZCoordinate=0)  # disabled

construct_point_9 = ConstructPoint(XCoordinate=concatenate_8, YCoordinate=concatenate_10, ZCoordinate=0)  # disabled
construct_point_10 = ConstructPoint(XCoordinate=text_split_10, YCoordinate=text_split_8, ZCoordinate=0)  # disabled

division = Division(A=segment_number, B=2)
division_2 = Division(A=segment_number_2, B=2)
division_3 = Division(A=segment_number_3, B=2)
division_4 = Division(A=segment_number_4, B=2)
addition = Addition(A=division, B=2)

# ---- group: POINT NUMBER
addition_2 = Addition(A="0", B=addition)

# ----
one_over_x = OneOverX(Value=addition_2)
duplicate_data = DuplicateData(Data=one_over_x, Number=addition_2, Order=True)
series = Series(Start=0, Step=graft(panel_9), Count=addition)
shift_list = ShiftList(List=duplicate_data, Shift=1, Wrap=False)
shift_list_2 = ShiftList(List=series, Shift=1, Wrap=False)
addition_3 = Addition(A=division_2, B=2)

# ---- group: POINT NUMBER
addition_4 = Addition(A="0", B=addition_3)

# ----
one_over_x_2 = OneOverX(Value=addition_4)
duplicate_data_2 = DuplicateData(Data=one_over_x_2, Number=addition_4, Order=True)
series_2 = Series(Start=0, Step=graft(panel_10), Count=addition_3)
shift_list_3 = ShiftList(List=duplicate_data_2, Shift=1, Wrap=False)
shift_list_4 = ShiftList(List=series_2, Shift=1, Wrap=False)
addition_5 = Addition(A=division_3, B=2)

# ---- group: POINT NUMBER
addition_6 = Addition(A="0", B=addition_5)

# ----
one_over_x_3 = OneOverX(Value=addition_6)
duplicate_data_3 = DuplicateData(Data=one_over_x_3, Number=addition_6, Order=True)
series_3 = Series(Start=0, Step=graft(panel_11), Count=addition_5)
shift_list_5 = ShiftList(List=duplicate_data_3, Shift=1, Wrap=False)
shift_list_6 = ShiftList(List=series_3, Shift=1, Wrap=False)
addition_7 = Addition(A=division_4, B=2)

# ---- group: POINT NUMBER
addition_8 = Addition(A="0", B=addition_7)

# ----
one_over_x_4 = OneOverX(Value=addition_8)
duplicate_data_4 = DuplicateData(Data=one_over_x_4, Number=addition_8, Order=True)
series_4 = Series(Start=0, Step=graft(panel_12), Count=addition_7)
shift_list_7 = ShiftList(List=duplicate_data_4, Shift=1, Wrap=False)
shift_list_8 = ShiftList(List=series_4, Shift=1, Wrap=False)
interpolate = Interpolate(Vertices=construct_point_2, Degree=11, Periodic=False, KnotStyle=2)  # -> Curve, Length, Domain
nurbs_curve = NurbsCurve(Vertices=construct_point_2, Degree=11, Periodic=False)  # -> Curve, Length, Domain; disabled
curve_9 = Curve(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)  # disabled
scale = Scale(Geometry=curve_9, Center=Point(0, 0, 0), Factor=65536)  # -> Geometry, Transform; disabled
curve_10 = Curve(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)  # disabled
number_5 = Number(expr("X*65536", shift_list_2))
bounds = Bounds(Numbers=number_5)
number_6 = Number(expr("X*65536", shift_list_4))
bounds_2 = Bounds(Numbers=number_6)
number_7 = Number(expr("X*65536", shift_list_6))
bounds_3 = Bounds(Numbers=number_7)
fast_loop_start = FastLoopStart(Iterations=2, D0=shift_list_7, D1=shift_list_8)  # -> port, Counter, Data, Data_2; disabled
reverse_list = ReverseList(List=shift_list)
shift_list_9 = ShiftList(List=reverse_list, Shift=-1, Wrap=False)  # -> reverse(List)
merge = Merge(Data1=reverse_list, Data2=shift_list_9)  # -> flatten(Result)
reverse_list_2 = ReverseList(List=shift_list_3)
shift_list_10 = ShiftList(List=reverse_list_2, Shift=-1, Wrap=False)  # -> reverse(List)
merge_2 = Merge(Data1=reverse_list_2, Data2=shift_list_10)  # -> flatten(Result)
number_8 = Number(expr("X*65536*4", shift_list_8))
bounds_4 = Bounds(Numbers=number_8)
curve_11 = Curve(interpolate.Curve)
end_points = EndPoints(Curve=curve_11)  # -> Start, End
rectangle_2pt = Rectangle2Pt(Plane=PlaneXY(0, 0, 0), PointA=end_points.Start, PointB=end_points.End, Radius=0)  # -> Rectangle, Length
graphmapper = GraphMapper(Curve=curve_11, Boundary=rectangle_2pt.Rectangle, Numbers=number_8, Input=bounds_4, Output=bounds_4, bobo=True)
number_9 = Number(expr("X/65536/4", graphmapper))
reverse_list_3 = ReverseList(List=shift_list_5)
shift_list_11 = ShiftList(List=reverse_list_3, Shift=-1, Wrap=False)  # -> reverse(List)
merge_3 = Merge(Data1=reverse_list_3, Data2=shift_list_11)  # -> flatten(Result)
reverse_list_4 = ReverseList(List=shift_list_7)
shift_list_12 = ShiftList(List=reverse_list_4, Shift=-1, Wrap=False)  # -> reverse(List)
merge_4 = Merge(Data1=reverse_list_4, Data2=shift_list_12)  # -> flatten(Result)
reverse_list_5 = ReverseList(List=shift_list_8)
shift_list_13 = ShiftList(List=reverse_list_5, Shift=-1, Wrap=False)  # -> reverse(List)
negative = Negative(Value=shift_list_13)
merge_5 = Merge(Data1=reverse_list_5, Data2=negative)  # -> flatten(Result)
fast_loop_end = FastLoopEnd(
    port=fast_loop_start.port,
    Exit=False,
    Data=fast_loop_start.Data,
    Data_2=fast_loop_start.Data_2,
    RecordData=False,
    TimeOutVal=0)  # -> flatten(D0), flatten(D1); disabled
shift_list_14 = ShiftList(List=merge, Shift=-1, Wrap=False)  # -> reverse(List)
merge_6 = Merge(Data1=merge, Data2=shift_list_14)  # -> flatten(Result)
shift_list_15 = ShiftList(List=merge_2, Shift=-1, Wrap=False)  # -> reverse(List)
merge_7 = Merge(Data1=merge_2, Data2=shift_list_15)  # -> flatten(Result)
shift_list_16 = ShiftList(List=merge_3, Shift=-1, Wrap=False)  # -> reverse(List)
merge_8 = Merge(Data1=merge_3, Data2=shift_list_16)  # -> flatten(Result)
shift_list_17 = ShiftList(List=merge_4, Shift=-1, Wrap=False)  # -> reverse(List)
merge_9 = Merge(Data1=merge_4, Data2=shift_list_17)  # -> flatten(Result)
shift_list_18 = ShiftList(List=merge_5, Shift=-1, Wrap=False)  # -> reverse(List)
merge_10 = Merge(Data1=merge_5, Data2=shift_list_18)  # -> flatten(Result)
shift_list_19 = ShiftList(List=merge_6, Shift=-1, Wrap=False)  # -> reverse(List)
merge_11 = Merge(Data1=merge_6, Data2=shift_list_19)  # -> flatten(Result)
shift_list_20 = ShiftList(List=merge_7, Shift=-1, Wrap=False)  # -> reverse(List)
merge_12 = Merge(Data1=merge_7, Data2=shift_list_20)  # -> flatten(Result)
shift_list_21 = ShiftList(List=merge_8, Shift=-1, Wrap=False)  # -> reverse(List)
merge_13 = Merge(Data1=merge_8, Data2=shift_list_21)  # -> flatten(Result)
shift_list_22 = ShiftList(List=merge_9, Shift=-1, Wrap=False)  # -> reverse(List)
merge_14 = Merge(Data1=merge_9, Data2=shift_list_22)  # -> flatten(Result)
true_only_button = TrueOnlyButton(LastSaveLocalization="neutral,N")  # disabled
shift_list_23 = ShiftList(List=merge_10, Shift=-1, Wrap=False)  # -> reverse(List)
merge_15 = Merge(Data1=merge_10, Data2=shift_list_23)  # -> flatten(Result)
shift_list_24 = ShiftList(List=merge_11, Shift=-1, Wrap=False)  # -> reverse(List)
merge_16 = Merge(Data1=merge_11, Data2=shift_list_24)  # -> flatten(Result)
shift_list_25 = ShiftList(List=merge_12, Shift=-1, Wrap=False)  # -> reverse(List)
merge_17 = Merge(Data1=merge_12, Data2=shift_list_25)  # -> flatten(Result)
shift_list_26 = ShiftList(List=merge_13, Shift=-1, Wrap=False)  # -> reverse(List)
merge_18 = Merge(Data1=merge_13, Data2=shift_list_26)  # -> flatten(Result)
shift_list_27 = ShiftList(List=merge_14, Shift=-1, Wrap=False)  # -> reverse(List)
merge_19 = Merge(Data1=merge_14, Data2=shift_list_27)  # -> flatten(Result)
shift_list_28 = ShiftList(List=merge_15, Shift=-1, Wrap=False)  # -> reverse(List)
merge_20 = Merge(Data1=merge_15, Data2=shift_list_28)  # -> flatten(Result)
turtle = DotNETVBScriptLEGACY(Forward=merge_4, Left=merge_5)  # -> Output, Points; inputs Forward: list, Left: list
# ---------- turtle: VB ----------
    Dim i As Integer
    Dim dir As New On3dVector(1, 0, 0)
    Dim pos As New On3dVector(0, 0, 0)
    Dim axis As New On3dVector(0, 0, 1)
    Dim pnts As New List(Of On3dVector)

    pnts.Add(pos)

    For i = 0 To Forward.Count() - 1
      Dim P As New On3dVector
      dir.Rotate(Left(i), axis)
      P = dir * Forward(i) + pnts(i)
      pnts.Add(P)
    Next

    Points = pnts
# ---------- end turtle ----------
loop_start = LoopStart(Repeat=1, Trigger=true_only_button, D0=shift_list_7, D1=shift_list_8)  # -> port, Counter, Data, Data_2; disabled
loop_end = LoopEnd(
    port=loop_start.port,
    Exit=False,
    Data=merge_4,
    Data_2=merge_5,
    TimeOutVal=0,
    pausedState=False,
    state="Constant & Record")  # -> flatten(D0), flatten(D1); disabled
shift_list_29 = ShiftList(List=turtle.Points, Shift=-1, Wrap=False)
point = Point(shift_list_29)
cull_duplicates = CullDuplicates(Points=point, Tolerance=1.164153218e-10, CullMode=1)  # -> Points, Indices, Valence
interpolate_t = InterpolateT(Vertices=cull_duplicates.Points, TangentStart=Vector(1, 0, 0), TangentEnd=Vector(1, 0, 0), KnotStyle=2)  # -> Curve, Length, Domain; disabled
interpolate_2 = Interpolate(Vertices=cull_duplicates.Points, Degree=3, Periodic=False, KnotStyle=2)  # -> Curve, Length, Domain
curve_12 = Curve(interpolate_2.Curve)
nurbs_curve_2 = NurbsCurve(Vertices=cull_duplicates.Points, Degree=11, Periodic=False)  # -> Curve, Length, Domain; disabled
evaluate_length = EvaluateLength(Curve=curve_12, Length=1, Normalized=True)  # -> Point, Tangent, Parameter
deconstruct = Deconstruct(Point=evaluate_length.Point)  # -> XComponent, YComponent, ZComponent
scale_nu = ScaleNU(
    Geometry=curve_12,
    Plane=PlaneXY(0, 0, 0),
    ScaleX=expr("1/X", deconstruct.XComponent),
    ScaleY=expr("1/X", deconstruct.YComponent),
    ScaleZ=expr("1/X", 1))  # -> Geometry, Transform
curve_13 = Curve(scale_nu.Geometry)
evaluate_length_2 = EvaluateLength(Curve=curve_13, Length=[0, 1], Normalized=True)  # -> Point, Tangent, Parameter
bounding_box = BoundingBox(Content=curve_13, Plane=PlaneXY(0, 0, 0), UnionBox=True)  # -> Box, Box_2
division_5 = Division(A=deconstruct.XComponent, B=deconstruct.YComponent)
format = Format(Format="{0:R}", Culture=127, Data0=division_5)
panel_17 = Panel(format)
deconstruct_box = DeconstructBox(Box=bounding_box.Box)  # -> Plane, X, Y, Z
interpolate_3 = Interpolate(Vertices=cull_duplicates.Points, Degree=3, Periodic=False, KnotStyle=2)  # -> Curve, Length, Domain; disabled
deconstruct_domain = DeconstructDomain(Domain=deconstruct_box.X)  # -> expr("ABS(X)", Start), End
deconstruct_domain_2 = DeconstructDomain(Domain=deconstruct_box.Y)  # -> expr("ABS(X)", Start), End
addition_9 = Addition(A=deconstruct_domain.Start, B=deconstruct_domain.End)
addition_10 = Addition(A=deconstruct_domain_2.Start, B=deconstruct_domain_2.End)
format_2 = Format(Format="{0:R}", Culture=127, Data0=evaluate_length_2.Tangent)
tangent = Panel(format_2)
scale_nu_2 = ScaleNU(Geometry=curve_13, Plane=PlaneXY(0, 0, 0), ScaleX=expr("1/X", addition_9), ScaleY=expr("1/X", addition_10), ScaleZ=1)  # -> Geometry, Transform; disabled
close_curve = CloseCurve(Curve=scale_nu_2.Geometry, Factor=0.5, Continuity=0)  # disabled
scale_2 = Scale(Geometry=curve_13, Center=Point(0, 0, 0), Factor=65536)  # -> Geometry, Transform
curve_14 = Curve(scale_2.Geometry)
end_points_2 = EndPoints(Curve=curve_14)  # -> Start, End
rectangle_2pt_2 = Rectangle2Pt(Plane=PlaneXY(0, 0, 0), PointA=end_points_2.Start, PointB=end_points_2.End, Radius=0)  # -> Rectangle, Length
graphmapper_2 = GraphMapper(Curve=curve_14, Boundary=rectangle_2pt_2.Rectangle, Numbers=number_7, Input=bounds_3, Output=bounds_3, bobo=True)
number_10 = Number(expr("X/65536", graphmapper_2))
fast_loop_start_2 = FastLoopStart(Iterations=2, D0=shift_list_5, D1=number_10)  # -> port, Counter, Data, Data_2; disabled
reverse_list_6 = ReverseList(List=number_10)
shift_list_30 = ShiftList(List=reverse_list_6, Shift=-1, Wrap=False)  # -> reverse(List)
negative_2 = Negative(Value=shift_list_30)
merge_21 = Merge(Data1=reverse_list_6, Data2=negative_2)  # -> flatten(Result)
fast_loop_end_2 = FastLoopEnd(
    port=fast_loop_start_2.port,
    Exit=False,
    Data=fast_loop_start_2.Data,
    Data_2=fast_loop_start_2.Data_2,
    RecordData=False,
    TimeOutVal=0)  # -> flatten(D0), flatten(D1); disabled
shift_list_31 = ShiftList(List=merge_21, Shift=-1, Wrap=False)  # -> reverse(List)
merge_22 = Merge(Data1=merge_21, Data2=shift_list_31)  # -> flatten(Result)
shift_list_32 = ShiftList(List=merge_22, Shift=-1, Wrap=False)  # -> reverse(List)
merge_23 = Merge(Data1=merge_22, Data2=shift_list_32)  # -> flatten(Result)
shift_list_33 = ShiftList(List=merge_23, Shift=-1, Wrap=False)  # -> reverse(List)
merge_24 = Merge(Data1=merge_23, Data2=shift_list_33)  # -> flatten(Result)
turtle_2 = DotNETVBScriptLEGACY(Forward=merge_3, Left=merge_21)  # -> Output, Points; inputs Forward: list, Left: list; same code as turtle
shift_list_34 = ShiftList(List=turtle_2.Points, Shift=-1, Wrap=False)
point_2 = Point(shift_list_34)
cull_duplicates_2 = CullDuplicates(Points=point_2, Tolerance=1.164153218e-10, CullMode=1)  # -> Points, Indices, Valence
interpolate_t_2 = InterpolateT(Vertices=cull_duplicates_2.Points, TangentStart=Vector(1, 0, 0), TangentEnd=Vector(1, 0, 0), KnotStyle=2)  # -> Curve, Length, Domain; disabled
interpolate_4 = Interpolate(Vertices=cull_duplicates_2.Points, Degree=3, Periodic=False, KnotStyle=2)  # -> Curve, Length, Domain
curve_15 = Curve(interpolate_4.Curve)
nurbs_curve_3 = NurbsCurve(Vertices=cull_duplicates_2.Points, Degree=11, Periodic=False)  # -> Curve, Length, Domain; disabled
evaluate_length_3 = EvaluateLength(Curve=curve_15, Length=1, Normalized=True)  # -> Point, Tangent, Parameter
deconstruct_2 = Deconstruct(Point=evaluate_length_3.Point)  # -> XComponent, YComponent, ZComponent
scale_nu_3 = ScaleNU(
    Geometry=curve_15,
    Plane=PlaneXY(0, 0, 0),
    ScaleX=expr("1/X", deconstruct_2.XComponent),
    ScaleY=expr("1/X", deconstruct_2.YComponent),
    ScaleZ=expr("1/X", 1))  # -> Geometry, Transform
curve_16 = Curve(scale_nu_3.Geometry)
evaluate_length_4 = EvaluateLength(Curve=curve_16, Length=[0, 1], Normalized=True)  # -> Point, Tangent, Parameter
bounding_box_2 = BoundingBox(Content=curve_16, Plane=PlaneXY(0, 0, 0), UnionBox=True)  # -> Box, Box_2
division_6 = Division(A=deconstruct_2.XComponent, B=deconstruct_2.YComponent)
format_3 = Format(Format="{0:R}", Culture=127, Data0=division_6)
panel_18 = Panel(format_3)
curve_17 = Curve(curve_16)
deconstruct_box_2 = DeconstructBox(Box=bounding_box_2.Box)  # -> Plane, X, Y, Z
interpolate_5 = Interpolate(Vertices=cull_duplicates_2.Points, Degree=3, Periodic=False, KnotStyle=2)  # -> Curve, Length, Domain; disabled
deconstruct_domain_3 = DeconstructDomain(Domain=deconstruct_box_2.X)  # -> expr("ABS(X)", Start), End
deconstruct_domain_4 = DeconstructDomain(Domain=deconstruct_box_2.Y)  # -> expr("ABS(X)", Start), End
addition_11 = Addition(A=deconstruct_domain_3.Start, B=deconstruct_domain_3.End)
addition_12 = Addition(A=deconstruct_domain_4.Start, B=deconstruct_domain_4.End)
format_4 = Format(Format="{0:R}", Culture=127, Data0=evaluate_length_4.Tangent)
tangent_2 = Panel(format_4)
scale_nu_4 = ScaleNU(Geometry=curve_16, Plane=PlaneXY(0, 0, 0), ScaleX=expr("1/X", addition_11), ScaleY=expr("1/X", addition_12), ScaleZ=1)  # -> Geometry, Transform; disabled
close_curve_2 = CloseCurve(Curve=scale_nu_4.Geometry, Factor=0.5, Continuity=0)  # disabled
scale_3 = Scale(Geometry=curve_16, Center=Point(0, 0, 0), Factor=65536)  # -> Geometry, Transform
curve_18 = Curve(scale_3.Geometry)
end_points_3 = EndPoints(Curve=curve_18)  # -> Start, End
rectangle_2pt_3 = Rectangle2Pt(Plane=PlaneXY(0, 0, 0), PointA=end_points_3.Start, PointB=end_points_3.End, Radius=0)  # -> Rectangle, Length
graphmapper_3 = GraphMapper(Curve=curve_18, Boundary=rectangle_2pt_3.Rectangle, Numbers=number_6, Input=bounds_2, Output=bounds_2, bobo=True)
number_11 = Number(expr("X/65536", graphmapper_3))
fast_loop_start_3 = FastLoopStart(Iterations=2, D0=shift_list_3, D1=number_11)  # -> port, Counter, Data, Data_2; disabled
reverse_list_7 = ReverseList(List=number_11)
shift_list_35 = ShiftList(List=reverse_list_7, Shift=-1, Wrap=False)  # -> reverse(List)
negative_3 = Negative(Value=shift_list_35)
merge_25 = Merge(Data1=reverse_list_7, Data2=negative_3)  # -> flatten(Result)
fast_loop_end_3 = FastLoopEnd(
    port=fast_loop_start_3.port,
    Exit=False,
    Data=fast_loop_start_3.Data,
    Data_2=fast_loop_start_3.Data_2,
    RecordData=False,
    TimeOutVal=0)  # -> flatten(D0), flatten(D1); disabled
shift_list_36 = ShiftList(List=merge_25, Shift=-1, Wrap=False)  # -> reverse(List)
merge_26 = Merge(Data1=merge_25, Data2=shift_list_36)  # -> flatten(Result)
shift_list_37 = ShiftList(List=merge_26, Shift=-1, Wrap=False)  # -> reverse(List)
merge_27 = Merge(Data1=merge_26, Data2=shift_list_37)  # -> flatten(Result)
shift_list_38 = ShiftList(List=merge_27, Shift=-1, Wrap=False)  # -> reverse(List)
merge_28 = Merge(Data1=merge_27, Data2=shift_list_38)  # -> flatten(Result)
turtle_3 = DotNETVBScriptLEGACY(Forward=merge_2, Left=merge_25)  # -> Output, Points; inputs Forward: list, Left: list; same code as turtle
shift_list_39 = ShiftList(List=turtle_3.Points, Shift=-1, Wrap=False)
point_3 = Point(shift_list_39)
cull_duplicates_3 = CullDuplicates(Points=point_3, Tolerance=1.164153218e-10, CullMode=1)  # -> Points, Indices, Valence
interpolate_t_3 = InterpolateT(Vertices=cull_duplicates_3.Points, TangentStart=Vector(1, 0, 0), TangentEnd=Vector(1, 0, 0), KnotStyle=2)  # -> Curve, Length, Domain; disabled
interpolate_6 = Interpolate(Vertices=cull_duplicates_3.Points, Degree=3, Periodic=False, KnotStyle=2)  # -> Curve, Length, Domain
curve_19 = Curve(interpolate_6.Curve)
nurbs_curve_4 = NurbsCurve(Vertices=cull_duplicates_3.Points, Degree=11, Periodic=False)  # -> Curve, Length, Domain; disabled
evaluate_length_5 = EvaluateLength(Curve=curve_19, Length=1, Normalized=True)  # -> Point, Tangent, Parameter
deconstruct_3 = Deconstruct(Point=evaluate_length_5.Point)  # -> XComponent, YComponent, ZComponent
scale_nu_5 = ScaleNU(
    Geometry=curve_19,
    Plane=PlaneXY(0, 0, 0),
    ScaleX=expr("1/X", deconstruct_3.XComponent),
    ScaleY=expr("1/X", deconstruct_3.YComponent),
    ScaleZ=expr("1/X", 1))  # -> Geometry, Transform
curve_20 = Curve(scale_nu_5.Geometry)
evaluate_length_6 = EvaluateLength(Curve=curve_20, Length=[0, 1], Normalized=True)  # -> Point, Tangent, Parameter
bounding_box_3 = BoundingBox(Content=curve_20, Plane=PlaneXY(0, 0, 0), UnionBox=True)  # -> Box, Box_2
division_7 = Division(A=deconstruct_3.XComponent, B=deconstruct_3.YComponent)
format_5 = Format(Format="{0:R}", Culture=127, Data0=division_7)
panel_19 = Panel(format_5)
curve_21 = Curve(curve_20)
deconstruct_box_3 = DeconstructBox(Box=bounding_box_3.Box)  # -> Plane, X, Y, Z
interpolate_7 = Interpolate(Vertices=cull_duplicates_3.Points, Degree=3, Periodic=False, KnotStyle=2)  # -> Curve, Length, Domain; disabled
deconstruct_domain_5 = DeconstructDomain(Domain=deconstruct_box_3.X)  # -> expr("ABS(X)", Start), End
deconstruct_domain_6 = DeconstructDomain(Domain=deconstruct_box_3.Y)  # -> expr("ABS(X)", Start), End
addition_13 = Addition(A=deconstruct_domain_5.Start, B=deconstruct_domain_5.End)
addition_14 = Addition(A=deconstruct_domain_6.Start, B=deconstruct_domain_6.End)
format_6 = Format(Format="{0:R}", Culture=127, Data0=evaluate_length_6.Tangent)
tangent_3 = Panel(format_6)
scale_nu_6 = ScaleNU(Geometry=curve_20, Plane=PlaneXY(0, 0, 0), ScaleX=expr("1/X", addition_13), ScaleY=expr("1/X", addition_14), ScaleZ=1)  # -> Geometry, Transform; disabled
close_curve_3 = CloseCurve(Curve=scale_nu_6.Geometry, Factor=0.5, Continuity=0)  # disabled
scale_4 = Scale(Geometry=curve_20, Center=Point(0, 0, 0), Factor=65536)  # -> Geometry, Transform
curve_22 = Curve(scale_4.Geometry)
end_points_4 = EndPoints(Curve=curve_22)  # -> Start, End
rectangle_2pt_4 = Rectangle2Pt(Plane=PlaneXY(0, 0, 0), PointA=end_points_4.Start, PointB=end_points_4.End, Radius=0)  # -> Rectangle, Length
graphmapper_4 = GraphMapper(Curve=curve_22, Boundary=rectangle_2pt_4.Rectangle, Numbers=number_5, Input=bounds, Output=bounds, bobo=True)
number_12 = Number(expr("X/65536", graphmapper_4))
fast_loop_start_4 = FastLoopStart(Iterations=2, D0=shift_list, D1=number_12)  # -> port, Counter, Data, Data_2; disabled
reverse_list_8 = ReverseList(List=number_12)
shift_list_40 = ShiftList(List=reverse_list_8, Shift=-1, Wrap=False)  # -> reverse(List)
negative_4 = Negative(Value=shift_list_40)
merge_29 = Merge(Data1=reverse_list_8, Data2=negative_4)  # -> flatten(Result)
fast_loop_end_4 = FastLoopEnd(
    port=fast_loop_start_4.port,
    Exit=False,
    Data=fast_loop_start_4.Data,
    Data_2=fast_loop_start_4.Data_2,
    RecordData=False,
    TimeOutVal=0)  # -> flatten(D0), flatten(D1); disabled
shift_list_41 = ShiftList(List=merge_29, Shift=-1, Wrap=False)  # -> reverse(List)
merge_30 = Merge(Data1=merge_29, Data2=shift_list_41)  # -> flatten(Result)
shift_list_42 = ShiftList(List=merge_30, Shift=-1, Wrap=False)  # -> reverse(List)
merge_31 = Merge(Data1=merge_30, Data2=shift_list_42)  # -> flatten(Result)
shift_list_43 = ShiftList(List=merge_31, Shift=-1, Wrap=False)  # -> reverse(List)
merge_32 = Merge(Data1=merge_31, Data2=shift_list_43)  # -> flatten(Result)
turtle_4 = DotNETVBScriptLEGACY(Forward=merge, Left=merge_29)  # -> Output, Points; inputs Forward: list, Left: list; same code as turtle
shift_list_44 = ShiftList(List=turtle_4.Points, Shift=-1, Wrap=False)
point_4 = Point(shift_list_44)
cull_duplicates_4 = CullDuplicates(Points=point_4, Tolerance=1.164153218e-10, CullMode=1)  # -> Points, Indices, Valence
interpolate_t_4 = InterpolateT(Vertices=cull_duplicates_4.Points, TangentStart=Vector(1, 0, 0), TangentEnd=Vector(1, 0, 0), KnotStyle=2)  # -> Curve, Length, Domain; disabled
interpolate_8 = Interpolate(Vertices=cull_duplicates_4.Points, Degree=3, Periodic=False, KnotStyle=2)  # -> Curve, Length, Domain
curve_23 = Curve(interpolate_8.Curve)
nurbs_curve_5 = NurbsCurve(Vertices=cull_duplicates_4.Points, Degree=11, Periodic=False)  # -> Curve, Length, Domain; disabled
evaluate_length_7 = EvaluateLength(Curve=curve_23, Length=1, Normalized=True)  # -> Point, Tangent, Parameter
deconstruct_4 = Deconstruct(Point=evaluate_length_7.Point)  # -> XComponent, YComponent, ZComponent
scale_nu_7 = ScaleNU(
    Geometry=curve_23,
    Plane=PlaneXY(0, 0, 0),
    ScaleX=expr("1/X", deconstruct_4.XComponent),
    ScaleY=expr("1/X", deconstruct_4.YComponent),
    ScaleZ=expr("1/X", 1))  # -> Geometry, Transform
curve_24 = Curve(scale_nu_7.Geometry)
evaluate_length_8 = EvaluateLength(Curve=curve_24, Length=[0, 1], Normalized=True)  # -> Point, Tangent, Parameter
bounding_box_4 = BoundingBox(Content=curve_24, Plane=PlaneXY(0, 0, 0), UnionBox=True)  # -> Box, Box_2
division_8 = Division(A=deconstruct_4.XComponent, B=deconstruct_4.YComponent)
format_7 = Format(Format="{0:R}", Culture=127, Data0=division_8)
panel_20 = Panel(format_7)
curve_25 = Curve(curve_24)
deconstruct_box_4 = DeconstructBox(Box=bounding_box_4.Box)  # -> Plane, X, Y, Z
interpolate_9 = Interpolate(Vertices=cull_duplicates_4.Points, Degree=3, Periodic=False, KnotStyle=2)  # -> Curve, Length, Domain; disabled
deconstruct_domain_7 = DeconstructDomain(Domain=deconstruct_box_4.X)  # -> expr("ABS(X)", Start), End
deconstruct_domain_8 = DeconstructDomain(Domain=deconstruct_box_4.Y)  # -> expr("ABS(X)", Start), End
addition_15 = Addition(A=deconstruct_domain_7.Start, B=deconstruct_domain_7.End)
addition_16 = Addition(A=deconstruct_domain_8.Start, B=deconstruct_domain_8.End)
format_8 = Format(Format="{0:R}", Culture=127, Data0=evaluate_length_8.Tangent)
tangent_4 = Panel(format_8)
scale_nu_8 = ScaleNU(Geometry=curve_24, Plane=PlaneXY(0, 0, 0), ScaleX=expr("1/X", addition_15), ScaleY=expr("1/X", addition_16), ScaleZ=1)  # -> Geometry, Transform; disabled
close_curve_4 = CloseCurve(Curve=scale_nu_8.Geometry, Factor=0.5, Continuity=0)  # disabled
curve_26 = Curve(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)  # disabled
curve_27 = Curve(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)  # disabled
digit_scroller = DigitScroller(Scroller_Digits=12, Scroller_Prefix="*", Scroller_Radix=1, Scroller_Value=0.0625)
digit_scroller_2 = DigitScroller(Scroller_Digits=12, Scroller_Prefix="*", Scroller_Radix=1, Scroller_Value=0.022265625)
digit_scroller_3 = DigitScroller(Scroller_Digits=12, Scroller_Prefix="მ6·მ6", Scroller_Radix=1, Scroller_Value=0.03125)  # "მ6·მ6"
digit_scroller_4 = DigitScroller(Scroller_Digits=12, Scroller_Prefix="∷·∷", Scroller_Radix=1, Scroller_Value=0.03125)
digit_scroller_5 = DigitScroller(Scroller_Digits=12, Scroller_Prefix="ЗԐ·ЗԐ", Scroller_Radix=1, Scroller_Value=0.03125)  # "ЗԐ·ЗԐ"
digit_scroller_6 = DigitScroller(Scroller_Digits=12, Scroller_Prefix="꞉·꞉", Scroller_Radix=1, Scroller_Value=0.03125)
digit_scroller_7 = DigitScroller(Scroller_Digits=12, Scroller_Prefix="△", Scroller_Radix=1, Scroller_Value=0.03125)
მ6 = DigitScroller(Scroller_Digits=12, Scroller_Prefix="მ6", Scroller_Radix=1, Scroller_Value=0.03125)
ਟ5 = DigitScroller(Scroller_Digits=12, Scroller_Prefix="ਟ5", Scroller_Radix=1, Scroller_Value=0.03125)
ᑐᑕ = DigitScroller(Scroller_Digits=12, Scroller_Prefix="ᑐᑕ", Scroller_Radix=1, Scroller_Value=0.03125)
digit_scroller_8 = DigitScroller(Scroller_Digits=12, Scroller_Prefix="ਟ5·ਟ5", Scroller_Radix=1, Scroller_Value=0.03125)  # "ਟ5·ਟ5"
digit_scroller_9 = DigitScroller(Scroller_Digits=12, Scroller_Prefix="···", Scroller_Radix=1, Scroller_Value=0.03125)
digit_scroller_10 = DigitScroller(Scroller_Digits=12, Scroller_Prefix="0·0", Scroller_Radix=1, Scroller_Value=0.03125)
digit_scroller_11 = DigitScroller(Scroller_Digits=12, Scroller_Prefix="⁂", Scroller_Radix=1, Scroller_Value=0.03125)
digit_scroller_12 = DigitScroller(Scroller_Digits=12, Scroller_Prefix="❋", Scroller_Radix=1, Scroller_Value=0.03125)
digit_scroller_13 = DigitScroller(Scroller_Digits=12, Scroller_Prefix="∷", Scroller_Radix=1, Scroller_Value=0.03125)
зԑ = DigitScroller(Scroller_Digits=12, Scroller_Prefix="ЗԐ", Scroller_Radix=1, Scroller_Value=0.03125)
digit_scroller_14 = DigitScroller(Scroller_Digits=12, Scroller_Prefix="꞉", Scroller_Radix=1, Scroller_Value=0.03125)
digit_scroller_15 = DigitScroller(Scroller_Digits=12, Scroller_Prefix="·", Scroller_Radix=1, Scroller_Value=0.03125)
turn_step_5 = DigitScroller(Scroller_Digits=12, Scroller_Prefix="TURN STEP", Scroller_Radix=2, Scroller_Value=5.9688e-06)
number_13 = Number(expr("X/4", segment_number_4))
panel_23 = Panel("0.00000596882150189902625")
segment_number_5 = DigitScroller(Scroller_Digits=12, Scroller_Prefix="SEGMENT NUMBER", Scroller_Radix=11, Scroller_Value=1024)
number_14 = Number(expr("DEG(X)", panel_23))
subtraction_5 = Subtraction(A=segment_number_5, B=2)
multiplication_5 = Multiplication(A=subtraction_5, B=2)
curwe_curwature_comb_lines_scale = CURWECURWATURECOMBLINESSCALE()  # CURWE CURWATURE COMB LINES SCALE
magnet_surface_input = MAGNETSURFACEINPUT()  # MAGNET SURFACE INPUT
surface = Surface(magnet_surface_input)
magnet_surface_output = MAGNETSURFACEOUTPUT(surface)  # MAGNET SURFACE OUTPUT
null_item = NullItem(Item=surface)  # -> NullFlags, InvalidFlags, Description
gate_not = GateNot(A=null_item.NullFlags)
division_9 = Division(A=segment_number_5, B=2)
addition_17 = Addition(A=division_9, B=2)

# ---- group: POINT NUMBER
addition_18 = Addition(A="0", B=addition_17)

# ----
one_over_x_5 = OneOverX(Value=addition_18)
duplicate_data_5 = DuplicateData(Data=one_over_x_5, Number=addition_18, Order=True)
series_5 = Series(Start=0, Step=graft(panel_23), Count=addition_17)
shift_list_45 = ShiftList(List=duplicate_data_5, Shift=1, Wrap=False)
shift_list_46 = ShiftList(List=series_5, Shift=1, Wrap=False)
object_bake = ObjectBake(BakeToggle=False, Layer="CURWE", ObjectName="CURWE", ObjectColor=RGB(255, 255, 255), LayerColor=RGB(255, 255, 255))
scale_5 = Scale(Geometry=curve_24, Center=Point(0, 0, 0), Factor=65536)  # -> Geometry, Transform
number_15 = Number(expr("X*65536", shift_list_46))
bounds_5 = Bounds(Numbers=number_15)
curve_28 = Curve(scale_5.Geometry)
end_points_5 = EndPoints(Curve=curve_28)  # -> Start, End
rectangle_2pt_5 = Rectangle2Pt(Plane=PlaneXY(0, 0, 0), PointA=end_points_5.Start, PointB=end_points_5.End, Radius=0)  # -> Rectangle, Length
graphmapper_5 = GraphMapper(Curve=curve_28, Boundary=rectangle_2pt_5.Rectangle, Numbers=number_15, Input=bounds_5, Output=bounds_5, bobo=True)
number_16 = Number(expr("X/65536", graphmapper_5))
fast_loop_start_5 = FastLoopStart(Iterations=2, D0=shift_list_45, D1=number_16)  # -> port, Counter, Data, Data_2; disabled
reverse_list_9 = ReverseList(List=shift_list_45)
shift_list_47 = ShiftList(List=reverse_list_9, Shift=-1, Wrap=False)  # -> reverse(List)
merge_33 = Merge(Data1=reverse_list_9, Data2=shift_list_47)  # -> flatten(Result)
reverse_list_10 = ReverseList(List=number_16)
shift_list_48 = ShiftList(List=reverse_list_10, Shift=-1, Wrap=False)  # -> reverse(List)
negative_5 = Negative(Value=shift_list_48)
merge_34 = Merge(Data1=reverse_list_10, Data2=negative_5)  # -> flatten(Result)
fast_loop_end_5 = FastLoopEnd(
    port=fast_loop_start_5.port,
    Exit=False,
    Data=fast_loop_start_5.Data,
    Data_2=fast_loop_start_5.Data_2,
    RecordData=False,
    TimeOutVal=0)  # -> flatten(D0), flatten(D1); disabled
shift_list_49 = ShiftList(List=shift_list_45, Shift=-1, Wrap=False)  # -> reverse(List)
merge_35 = Merge(Data1=shift_list_45, Data2=shift_list_49)  # -> flatten(Result)
shift_list_50 = ShiftList(List=number_16, Shift=-1, Wrap=False)  # -> reverse(List)
merge_36 = Merge(Data1=number_16, Data2=shift_list_50)  # -> flatten(Result)
shift_list_51 = ShiftList(List=merge_35, Shift=-1, Wrap=False)  # -> reverse(List)
merge_37 = Merge(Data1=merge_35, Data2=shift_list_51)  # -> flatten(Result)
shift_list_52 = ShiftList(List=merge_36, Shift=-1, Wrap=False)  # -> reverse(List)
merge_38 = Merge(Data1=merge_36, Data2=shift_list_52)  # -> flatten(Result)
shift_list_53 = ShiftList(List=merge_37, Shift=-1, Wrap=False)  # -> reverse(List)
merge_39 = Merge(Data1=merge_37, Data2=shift_list_53)  # -> flatten(Result)
shift_list_54 = ShiftList(List=merge_38, Shift=-1, Wrap=False)  # -> reverse(List)
merge_40 = Merge(Data1=merge_38, Data2=shift_list_54)  # -> flatten(Result)
turtle_5 = DotNETVBScriptLEGACY(Forward=merge_35, Left=merge_36)  # -> Output, Points; inputs Forward: list, Left: list; same code as turtle
shift_list_55 = ShiftList(List=turtle_5.Points, Shift=-1, Wrap=False)
point_5 = Point(shift_list_55)
interpolate_t_5 = InterpolateT(Vertices=point_5, TangentStart=Vector(1, 0, 0), TangentEnd=Vector(1, 0, 0), KnotStyle=2)  # -> Curve, Length, Domain; disabled
interpolate_10 = Interpolate(Vertices=point_5, Degree=3, Periodic=False, KnotStyle=2)  # -> Curve, Length, Domain
curve_29 = Curve(interpolate_10.Curve)
nurbs_curve_6 = NurbsCurve(Vertices=point_5, Degree=11, Periodic=False)  # -> Curve, Length, Domain; disabled
cull_duplicates_5 = CullDuplicates(Points=point_5, Tolerance=1.164153218e-10, CullMode=1)  # -> Points, Indices, Valence; disabled
evaluate_length_9 = EvaluateLength(Curve=curve_29, Length=1, Normalized=True)  # -> Point, Tangent, Parameter
deconstruct_5 = Deconstruct(Point=evaluate_length_9.Point)  # -> XComponent, YComponent, ZComponent
scale_nu_9 = ScaleNU(
    Geometry=curve_29,
    Plane=PlaneXY(0, 0, 0),
    ScaleX=expr(".5/X", deconstruct_5.XComponent),
    ScaleY=expr(".5/X", deconstruct_5.YComponent),
    ScaleZ=1)  # -> Geometry, Transform
curve_30 = Curve(scale_nu_9.Geometry)
polar_array = PolarArray(Geometry=curve_30, Plane=PlaneXY(0, 0.5, 0), Count=4, Angle=6.283185307)  # -> Geometry, Transform
move = Move(Geometry=polar_array.Geometry, Motion=Vector(0, -0.5, 0))  # -> Geometry, Transform
list_item = ListItem(List=move.Geometry, Index=1, Wrap=False)
curve_31 = Curve(list_item)
evaluate_length_10 = EvaluateLength(Curve=curve_30, Length=[0, 1], Normalized=True)  # -> Point, Tangent, Parameter
bounding_box_5 = BoundingBox(Content=curve_30, Plane=PlaneXY(0, 0, 0), UnionBox=True)  # -> Box, Box_2
division_10 = Division(A=deconstruct_5.XComponent, B=deconstruct_5.YComponent)
format_9 = Format(Format="{0:R}", Culture=127, Data0=division_10)
panel_24 = Panel(format_9)
curve_32 = Curve(curve_30)
deconstruct_box_5 = DeconstructBox(Box=bounding_box_5.Box)  # -> Plane, X, Y, Z
diference_curwature_shaped_graph = DIFERENCECURWATURESHAPEDGRAPH(
    B_2=digit_scroller,
    B_17=digit_scroller,
    B_3=digit_scroller,
    B_4=digit_scroller,
    B_5=digit_scroller,
    B_6=digit_scroller,
    B_7=digit_scroller,
    B_8=digit_scroller,
    B_9=digit_scroller,
    B_10=digit_scroller,
    B_11=digit_scroller,
    B_12=digit_scroller,
    B_13=digit_scroller,
    B_14=digit_scroller,
    B_15=digit_scroller,
    B_16=digit_scroller,
    B=digit_scroller,
    count=number_13,
    curve=curve_31)  # -> relay_3, relay_17, relay_4, relay_5, relay_6, relay_7, relay_8, relay_9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; disabled
interpolate_11 = Interpolate(Vertices=cull_duplicates_5.Points, Degree=3, Periodic=False, KnotStyle=2)  # -> Curve, Length, Domain; disabled
deconstruct_domain_9 = DeconstructDomain(Domain=deconstruct_box_5.X)  # -> expr("ABS(X)", Start), End
deconstruct_domain_10 = DeconstructDomain(Domain=deconstruct_box_5.Y)  # -> expr("ABS(X)", Start), End
addition_19 = Addition(A=deconstruct_domain_9.Start, B=deconstruct_domain_9.End)
addition_20 = Addition(A=deconstruct_domain_10.Start, B=deconstruct_domain_10.End)
format_10 = Format(Format="{0:R}", Culture=127, Data0=evaluate_length_10.Tangent)
tangent_5 = Panel(format_10)
scale_nu_10 = ScaleNU(Geometry=curve_30, Plane=PlaneXY(0, 0, 0), ScaleX=expr("1/X", addition_19), ScaleY=expr("1/X", addition_20), ScaleZ=1)  # -> Geometry, Transform; disabled
close_curve_5 = CloseCurve(Curve=scale_nu_10.Geometry, Factor=0.5, Continuity=0)  # disabled

curwe_curwature_combs_torsion_rotation_a = CURWECURWATURECOMBSTORSIONROTATIONANGLEINPUT()  # CURWE CURWATURE COMBS TORSION ROTATION ANGLE INPUT
digit_scroller_16 = DigitScroller(Scroller_Digits=12, Scroller_Prefix=" ", Scroller_Radix=11, Scroller_Value=87)  # disabled
curwe_point_number_input = CURWEPOINTNUMBERINPUT()  # CURWE POINT NUMBER INPUT
create_material = CreateMaterial(Diffuse=RGB(223, 223, 223), Specular=RGB(0, 255, 255), Emission=RGB(0, 0, 0), Transparency=0.5, Shine=100)
create_material_2 = CreateMaterial(Diffuse=RGB(248, 248, 248), Specular=RGB(0, 255, 255), Emission=RGB(0, 0, 0), Transparency=0.5, Shine=100)
create_material_3 = CreateMaterial(Diffuse=RGB(211, 211, 211), Specular=RGB(0, 255, 255), Emission=RGB(0, 0, 0), Transparency=0.5, Shine=100)
curwe_input = CURWEINPUT()  # CURWE INPUT
number_17 = Number(256)
curwe_point_number_output = CURWEPOINTNUMBEROUTPUT(number_17)  # CURWE POINT NUMBER OUTPUT
number_18 = Number(graft([0, 180]))
curwe_curwature_combs_torsion_rotation_a_2 = CURWECURWATURECOMBSTORSIONROTATIONANGLEOUTPUT(number_18)  # CURWE CURWATURE COMBS TORSION ROTATION ANGLE OUTPUT
curve_33 = Curve(graft(curve_31))
curve_34 = Curve(curve_33)
divide_curve = DivideCurve(Curve=curve_34, Count=number_17, Kinks=False)  # -> Points, Tangents, Parameters
line_sdl = LineSDL(Start=divide_curve.Points, Direction=divide_curve.Tangents, Length=-1)
curvature = Curvature(Curve=curve_34, Parameter=divide_curve.Parameters)  # -> Point, Curvature, Curvature_2
rotate = Rotate(Vector=curvature.Curvature, Axis=line_sdl, Angle=degrees(number_18))
deconstruct_arc = DeconstructArc(Arc=curvature.Curvature_2)  # -> BasePlane, Radius, Angle
line = Line(StartPoint=curvature.Point, EndPoint=deconstruct_arc.BasePlane)
control_points = ControlPoints(Curve=curve_34)  # -> Points, Weights, Knots
list_length = ListLength(List=control_points.Points)  # -> expr("X-1", Length)
curve_degree = CurveDegree(Curve=curve_34)
expression = Expression(A=list_length, B=curve_degree, Expression="A-B+1")
length = Length(Curve=curve_34)
one_over_x_6 = OneOverX(Value=deconstruct_arc.Radius)
quick_graph = QuickGraph(one_over_x_6, SortOrder=0)
format_11 = Format(Format="{0:R}", Culture=127, Data0=one_over_x_6)  # disabled
panel_25 = Panel(format_11)
bounds_6 = Bounds(Numbers=one_over_x_6)
remap_numbers = RemapNumbers(Value=one_over_x_6, Source=bounds_6, Target=Domain(0, 1))  # -> Mapped, Clipped
curvature_graph = CurvatureGraph(Curve=curve_34, Density=1, Scale=digit_scroller_16)  # disabled
multiplication_6 = Multiplication(A=length, B=remap_numbers.Mapped)
multiplication_7 = Multiplication(A=multiplication_6, B=digit_scroller_2)
line_sdl_2 = LineSDL(Start=curvature.Point, Direction=rotate, Length=expr("-X", multiplication_7))
number_19 = Number(expression)
number_20 = Number(number_19)

replace_nulls = ReplaceNulls(Items=one_over_x_6, Replacements=0)  # -> Items, Count
relative_differences = RelativeDifferences(Values=replace_nulls.Items)
shift_list_56 = ShiftList(List=relative_differences, Shift=1, Wrap=False)

curwe_curwature_first_diference_comb_lin = CURWECURWATUREFIRSTDIFERENCECOMBLINESSCALE()  # CURWE CURWATURE FIRST DIFERENCE COMB LINES SCALE
bounds_7 = Bounds(Numbers=shift_list_56)
remap_numbers_2 = RemapNumbers(Value=shift_list_56, Source=bounds_7, Target=Domain(-1, 1))  # -> Mapped, Clipped
multiplication_8 = Multiplication(A=length, B=remap_numbers_2.Mapped)
multiplication_9 = Multiplication(A=multiplication_8, B=digit_scroller_2)

replace_nulls_2 = ReplaceNulls(Items=shift_list_56, Replacements=0)  # -> Items, Count
relative_differences_2 = RelativeDifferences(Values=replace_nulls_2.Items)
shift_list_57 = ShiftList(List=relative_differences_2, Shift=1, Wrap=False)

replace_nulls_3 = ReplaceNulls(Items=shift_list_57, Replacements=0)  # -> Items, Count
relative_differences_3 = RelativeDifferences(Values=replace_nulls_3.Items)
shift_list_58 = ShiftList(List=relative_differences_3, Shift=1, Wrap=False)

replace_nulls_4 = ReplaceNulls(Items=shift_list_58, Replacements=0)  # -> Items, Count
relative_differences_4 = RelativeDifferences(Values=replace_nulls_4.Items)
shift_list_59 = ShiftList(List=relative_differences_4, Shift=1, Wrap=False)

replace_nulls_5 = ReplaceNulls(Items=shift_list_59, Replacements=0)  # -> Items, Count
relative_differences_5 = RelativeDifferences(Values=replace_nulls_5.Items)
shift_list_60 = ShiftList(List=relative_differences_5, Shift=1, Wrap=False)

expression_2 = Expression(O=shift_list_60, Expression="FORMAT(\"{0:R}\",O)")  # disabled
format_12 = Format(Format="{0:R}", Culture=127, Data0=shift_list_60)  # disabled
panel_26 = Panel(format_12)

replace_nulls_6 = ReplaceNulls(Items=shift_list_60, Replacements=0)  # -> Items, Count
relative_differences_6 = RelativeDifferences(Values=replace_nulls_6.Items)
shift_list_61 = ShiftList(List=relative_differences_6, Shift=1, Wrap=False)

replace_nulls_7 = ReplaceNulls(Items=shift_list_61, Replacements=0)  # -> Items, Count
relative_differences_7 = RelativeDifferences(Values=replace_nulls_7.Items)
shift_list_62 = ShiftList(List=relative_differences_7, Shift=1, Wrap=False)

replace_nulls_8 = ReplaceNulls(Items=shift_list_62, Replacements=0)  # -> Items, Count; disabled
relative_differences_8 = RelativeDifferences(Values=replace_nulls_8.Items)  # disabled
shift_list_63 = ShiftList(List=relative_differences_8, Shift=1, Wrap=False)  # disabled

replace_nulls_9 = ReplaceNulls(Items=shift_list_63, Replacements=0)  # -> Items, Count; disabled
relative_differences_9 = RelativeDifferences(Values=replace_nulls_9.Items)  # disabled
shift_list_64 = ShiftList(List=relative_differences_9, Shift=1, Wrap=False)  # disabled

replace_nulls_10 = ReplaceNulls(Items=shift_list_64, Replacements=0)  # -> Items, Count; disabled
relative_differences_10 = RelativeDifferences(Values=replace_nulls_10.Items)  # disabled
shift_list_65 = ShiftList(List=relative_differences_10, Shift=1, Wrap=False)  # disabled

replace_nulls_11 = ReplaceNulls(Items=shift_list_65, Replacements=0)  # -> Items, Count; disabled
relative_differences_11 = RelativeDifferences(Values=replace_nulls_11.Items)  # disabled
shift_list_66 = ShiftList(List=relative_differences_11, Shift=1, Wrap=False)  # disabled

replace_nulls_12 = ReplaceNulls(Items=shift_list_66, Replacements=0)  # -> Items, Count; disabled
relative_differences_12 = RelativeDifferences(Values=replace_nulls_12.Items)  # disabled
shift_list_67 = ShiftList(List=relative_differences_12, Shift=1, Wrap=False)  # disabled

replace_nulls_13 = ReplaceNulls(Items=shift_list_67, Replacements=0)  # -> Items, Count; disabled
relative_differences_13 = RelativeDifferences(Values=replace_nulls_13.Items)  # disabled
shift_list_68 = ShiftList(List=relative_differences_13, Shift=1, Wrap=False)  # disabled

replace_nulls_14 = ReplaceNulls(Items=shift_list_68, Replacements=0)  # -> Items, Count; disabled
relative_differences_14 = RelativeDifferences(Values=replace_nulls_14.Items)  # disabled
shift_list_69 = ShiftList(List=relative_differences_14, Shift=1, Wrap=False)  # disabled

replace_nulls_15 = ReplaceNulls(Items=shift_list_69, Replacements=0)  # -> Items, Count; disabled
relative_differences_15 = RelativeDifferences(Values=replace_nulls_15.Items)  # disabled
shift_list_70 = ShiftList(List=relative_differences_15, Shift=1, Wrap=False)  # disabled

replace_nulls_16 = ReplaceNulls(Items=shift_list_70, Replacements=0)  # -> Items, Count; disabled
relative_differences_16 = RelativeDifferences(Values=replace_nulls_16.Items)  # disabled
shift_list_71 = ShiftList(List=relative_differences_16, Shift=1, Wrap=False)  # disabled

format_13 = Format(Format="{0:R}", Culture=127, Data0=shift_list_71)  # disabled
panel_27 = Panel(format_13)  # disabled

format_14 = Format(Format="{0:R}", Culture=127, Data0=shift_list_70)  # disabled
panel_28 = Panel(format_14)  # disabled

format_15 = Format(Format="{0:R}", Culture=127, Data0=shift_list_69)  # disabled
panel_29 = Panel(format_15)  # disabled

format_16 = Format(Format="{0:R}", Culture=127, Data0=shift_list_68)  # disabled
panel_30 = Panel(format_16)  # disabled

format_17 = Format(Format="{0:R}", Culture=127, Data0=shift_list_67)  # disabled
panel_31 = Panel(format_17)  # disabled

format_18 = Format(Format="{0:R}", Culture=127, Data0=shift_list_66)  # disabled
panel_32 = Panel(format_18)  # disabled

format_19 = Format(Format="{0:R}", Culture=127, Data0=shift_list_65)  # disabled
panel_33 = Panel(format_19)  # disabled

format_20 = Format(Format="{0:R}", Culture=127, Data0=shift_list_64)  # disabled
panel_34 = Panel(format_20)  # disabled

format_21 = Format(Format="{0:R}", Culture=127, Data0=shift_list_63)  # disabled
panel_35 = Panel(format_21)  # disabled

format_22 = Format(Format="{0:R}", Culture=127, Data0=shift_list_62)  # disabled
panel_36 = Panel(format_22)

format_23 = Format(Format="{0:R}", Culture=127, Data0=shift_list_61)  # disabled
panel_37 = Panel(format_23)

format_24 = Format(Format="{0:R}", Culture=127, Data0=shift_list_59)  # disabled
panel_38 = Panel(format_24)

format_25 = Format(Format="{0:R}", Culture=127, Data0=shift_list_58)  # disabled
panel_39 = Panel(format_25)

format_26 = Format(Format="{0:R}", Culture=127, Data0=shift_list_57)  # disabled
panel_40 = Panel(format_26)

format_27 = Format(Format="{0:R}", Culture=127, Data0=shift_list_56)  # disabled
panel_41 = Panel(format_27)

format_28 = Format(Format="{0:R}", Culture=127, Data0=deconstruct_arc.Radius)  # disabled
panel_42 = Panel(format_28)

pull_curve = PullCurve(Curve=line_sdl_2, Surface=surface)  # disabled

bounds_8 = Bounds(Numbers=shift_list_71)  # disabled
remap_numbers_3 = RemapNumbers(Value=shift_list_71, Source=bounds_8, Target=Domain(-1, 1))  # -> Mapped, Clipped; disabled
multiplication_10 = Multiplication(A=length, B=remap_numbers_3.Mapped)  # disabled
B = B()  # disabled
multiplication_11 = Multiplication(A=multiplication_10, B=B)  # disabled

bounds_9 = Bounds(Numbers=shift_list_70)  # disabled
remap_numbers_4 = RemapNumbers(Value=shift_list_70, Source=bounds_9, Target=Domain(-1, 1))  # -> Mapped, Clipped; disabled
multiplication_12 = Multiplication(A=length, B=remap_numbers_4.Mapped)  # disabled
B_2 = B()  # disabled
multiplication_13 = Multiplication(A=multiplication_12, B=B_2)  # disabled

bounds_10 = Bounds(Numbers=shift_list_69)  # disabled
remap_numbers_5 = RemapNumbers(Value=shift_list_69, Source=bounds_10, Target=Domain(-1, 1))  # -> Mapped, Clipped; disabled
multiplication_14 = Multiplication(A=length, B=remap_numbers_5.Mapped)  # disabled
B_3 = B()  # disabled
multiplication_15 = Multiplication(A=multiplication_14, B=B_3)  # disabled

bounds_11 = Bounds(Numbers=shift_list_68)  # disabled
remap_numbers_6 = RemapNumbers(Value=shift_list_68, Source=bounds_11, Target=Domain(-1, 1))  # -> Mapped, Clipped; disabled
multiplication_16 = Multiplication(A=length, B=remap_numbers_6.Mapped)  # disabled
B_4 = B()  # disabled
multiplication_17 = Multiplication(A=multiplication_16, B=B_4)  # disabled

bounds_12 = Bounds(Numbers=shift_list_67)  # disabled
remap_numbers_7 = RemapNumbers(Value=shift_list_67, Source=bounds_12, Target=Domain(-1, 1))  # -> Mapped, Clipped; disabled
multiplication_18 = Multiplication(A=length, B=remap_numbers_7.Mapped)  # disabled
B_5 = B()  # disabled
multiplication_19 = Multiplication(A=multiplication_18, B=B_5)  # disabled

bounds_13 = Bounds(Numbers=shift_list_66)  # disabled
remap_numbers_8 = RemapNumbers(Value=shift_list_66, Source=bounds_13, Target=Domain(-1, 1))  # -> Mapped, Clipped; disabled
multiplication_20 = Multiplication(A=length, B=remap_numbers_8.Mapped)  # disabled
B_6 = B()  # disabled
multiplication_21 = Multiplication(A=multiplication_20, B=B_6)  # disabled

bounds_14 = Bounds(Numbers=shift_list_65)  # disabled
remap_numbers_9 = RemapNumbers(Value=shift_list_65, Source=bounds_14, Target=Domain(-1, 1))  # -> Mapped, Clipped; disabled
multiplication_22 = Multiplication(A=length, B=remap_numbers_9.Mapped)  # disabled
B_7 = B()  # disabled
multiplication_23 = Multiplication(A=multiplication_22, B=B_7)  # disabled

bounds_15 = Bounds(Numbers=shift_list_64)  # disabled
remap_numbers_10 = RemapNumbers(Value=shift_list_64, Source=bounds_15, Target=Domain(-1, 1))  # -> Mapped, Clipped; disabled
multiplication_24 = Multiplication(A=length, B=remap_numbers_10.Mapped)  # disabled
B_8 = B()  # disabled
multiplication_25 = Multiplication(A=multiplication_24, B=B_8)  # disabled

bounds_16 = Bounds(Numbers=shift_list_63)  # disabled
remap_numbers_11 = RemapNumbers(Value=shift_list_63, Source=bounds_16, Target=Domain(-1, 1))  # -> Mapped, Clipped; disabled
multiplication_26 = Multiplication(A=length, B=remap_numbers_11.Mapped)  # disabled
B_9 = B()  # disabled
multiplication_27 = Multiplication(A=multiplication_26, B=B_9)  # disabled

bounds_17 = Bounds(Numbers=shift_list_62)
remap_numbers_12 = RemapNumbers(Value=shift_list_62, Source=bounds_17, Target=Domain(-1, 1))  # -> Mapped, Clipped
multiplication_28 = Multiplication(A=length, B=remap_numbers_12.Mapped)
multiplication_29 = Multiplication(A=multiplication_28, B=digit_scroller_2)
B_10 = B()

bounds_18 = Bounds(Numbers=shift_list_61)
remap_numbers_13 = RemapNumbers(Value=shift_list_61, Source=bounds_18, Target=Domain(-1, 1))  # -> Mapped, Clipped
multiplication_30 = Multiplication(A=length, B=remap_numbers_13.Mapped)
multiplication_31 = Multiplication(A=multiplication_30, B=digit_scroller_2)
B_11 = B()

bounds_19 = Bounds(Numbers=shift_list_60)
remap_numbers_14 = RemapNumbers(Value=shift_list_60, Source=bounds_19, Target=Domain(-1, 1))  # -> Mapped, Clipped
multiplication_32 = Multiplication(A=length, B=remap_numbers_14.Mapped)
multiplication_33 = Multiplication(A=multiplication_32, B=digit_scroller_2)
B_12 = B()

bounds_20 = Bounds(Numbers=shift_list_59)
remap_numbers_15 = RemapNumbers(Value=shift_list_59, Source=bounds_20, Target=Domain(-1, 1))  # -> Mapped, Clipped
multiplication_34 = Multiplication(A=length, B=remap_numbers_15.Mapped)
multiplication_35 = Multiplication(A=multiplication_34, B=digit_scroller_2)
B_13 = B()

bounds_21 = Bounds(Numbers=shift_list_58)
remap_numbers_16 = RemapNumbers(Value=shift_list_58, Source=bounds_21, Target=Domain(-1, 1))  # -> Mapped, Clipped
multiplication_36 = Multiplication(A=length, B=remap_numbers_16.Mapped)
multiplication_37 = Multiplication(A=multiplication_36, B=digit_scroller_2)
B_14 = B()

bounds_22 = Bounds(Numbers=shift_list_57)
remap_numbers_17 = RemapNumbers(Value=shift_list_57, Source=bounds_22, Target=Domain(-1, 1))  # -> Mapped, Clipped
multiplication_38 = Multiplication(A=length, B=remap_numbers_17.Mapped)
multiplication_39 = Multiplication(A=multiplication_38, B=digit_scroller_2)
B_15 = B()

pull_curve_2 = PullCurve(Curve=curve_34, Surface=surface)
stream_filter = StreamFilter(Gate=gate_not, Stream0=curve_34, Stream1=pull_curve_2)

curwe_output = CURWEOUTPUT(stream_filter)  # CURWE OUTPUT

end_points_6 = EndPoints(Curve=line_sdl_2)  # -> Start, End
pull_point = PullPoint(Point=end_points_6.Start, Geometry=surface, ClosestOnly=True)  # -> ClosestPoint, Distance
pull_point_2 = PullPoint(Point=end_points_6.End, Geometry=surface, ClosestOnly=True)  # -> ClosestPoint, Distance
line_2 = Line(StartPoint=pull_point.ClosestPoint, EndPoint=pull_point_2.ClosestPoint)

stream_filter_2 = StreamFilter(Gate=gate_not, Stream0=line_sdl_2, Stream1=line_2)

curwe_curwature_comb_scaled_lines = CURWECURWATURECOMBSCALEDLINES(stream_filter_2)  # CURWE CURWATURE COMB SCALED LINES
evaluate_length_11 = EvaluateLength(Curve=stream_filter_2, Length=1, Normalized=True)  # -> Point, Tangent, Parameter
custom_preview = CustomPreview(Geometry=stream_filter_2, Material=create_material_2)
custom_preview_2 = CustomPreview(Geometry=stream_filter, Material=create_material_3)

pull_point_3 = PullPoint(Point=evaluate_length_11.Point, Geometry=surface, ClosestOnly=True)  # -> ClosestPoint, Distance
stream_filter_3 = StreamFilter(Gate=gate_not, Stream0=evaluate_length_11.Point, Stream1=pull_point_3.ClosestPoint)

interpolate_12 = Interpolate(Vertices=stream_filter_3, Degree=1, Periodic=False, KnotStyle=2)  # -> Curve, Length, Domain
curve_35 = Curve(interpolate_12.Curve)
custom_preview_3 = CustomPreview(Geometry=curve_35, Material=create_material)

explode = Explode(Curve=curve_35, Recursive=True)  # -> Segments, Vertices
evaluate_length_12 = EvaluateLength(Curve=explode.Segments, Length=0.5, Normalized=True)  # -> Point, Tangent, Parameter
curve_closest_point = CurveClosestPoint(Point=evaluate_length_12.Point, Curve=curve_34)  # -> Point, Parameter, Distance
line_3 = Line(StartPoint=curve_closest_point.Point, EndPoint=evaluate_length_12.Point)

create_material_4 = CreateMaterial(Diffuse=RGB(99, 99, 99), Specular=RGB(0, 255, 255), Emission=RGB(0, 0, 0), Transparency=0.5, Shine=100)  # disabled
create_material_5 = CreateMaterial(Diffuse=RGB(125, 125, 125), Specular=RGB(0, 255, 255), Emission=RGB(0, 0, 0), Transparency=0.5, Shine=100)  # disabled
quick_graph_2 = QuickGraph(shift_list_71, SortOrder=0)  # disabled

create_material_6 = CreateMaterial(Diffuse=RGB(107, 107, 107), Specular=RGB(0, 255, 255), Emission=RGB(0, 0, 0), Transparency=0.5, Shine=100)  # disabled
create_material_7 = CreateMaterial(Diffuse=RGB(133, 133, 133), Specular=RGB(0, 255, 255), Emission=RGB(0, 0, 0), Transparency=0.5, Shine=100)  # disabled
quick_graph_3 = QuickGraph(shift_list_70, SortOrder=0)  # disabled

create_material_8 = CreateMaterial(Diffuse=RGB(115, 115, 115), Specular=RGB(0, 255, 255), Emission=RGB(0, 0, 0), Transparency=0.5, Shine=100)  # disabled
create_material_9 = CreateMaterial(Diffuse=RGB(140, 140, 140), Specular=RGB(0, 255, 255), Emission=RGB(0, 0, 0), Transparency=0.5, Shine=100)  # disabled
quick_graph_4 = QuickGraph(shift_list_69, SortOrder=0)  # disabled

create_material_10 = CreateMaterial(Diffuse=RGB(122, 122, 122), Specular=RGB(0, 255, 255), Emission=RGB(0, 0, 0), Transparency=0.5, Shine=100)  # disabled
create_material_11 = CreateMaterial(Diffuse=RGB(148, 148, 148), Specular=RGB(0, 255, 255), Emission=RGB(0, 0, 0), Transparency=0.5, Shine=100)  # disabled
quick_graph_5 = QuickGraph(shift_list_68, SortOrder=0)  # disabled

create_material_12 = CreateMaterial(Diffuse=RGB(130, 130, 130), Specular=RGB(0, 255, 255), Emission=RGB(0, 0, 0), Transparency=0.5, Shine=100)  # disabled
create_material_13 = CreateMaterial(Diffuse=RGB(156, 156, 156), Specular=RGB(0, 255, 255), Emission=RGB(0, 0, 0), Transparency=0.5, Shine=100)  # disabled
quick_graph_6 = QuickGraph(shift_list_67, SortOrder=0)  # disabled

create_material_14 = CreateMaterial(Diffuse=RGB(138, 138, 138), Specular=RGB(0, 255, 255), Emission=RGB(0, 0, 0), Transparency=0.5, Shine=100)  # disabled
create_material_15 = CreateMaterial(Diffuse=RGB(163, 163, 163), Specular=RGB(0, 255, 255), Emission=RGB(0, 0, 0), Transparency=0.5, Shine=100)  # disabled
quick_graph_7 = QuickGraph(shift_list_66, SortOrder=0)  # disabled

create_material_16 = CreateMaterial(Diffuse=RGB(145, 145, 145), Specular=RGB(0, 255, 255), Emission=RGB(0, 0, 0), Transparency=0.5, Shine=100)  # disabled
create_material_17 = CreateMaterial(Diffuse=RGB(171, 171, 171), Specular=RGB(0, 255, 255), Emission=RGB(0, 0, 0), Transparency=0.5, Shine=100)  # disabled
quick_graph_8 = QuickGraph(shift_list_65, SortOrder=0)  # disabled

create_material_18 = CreateMaterial(Diffuse=RGB(153, 153, 153), Specular=RGB(0, 255, 255), Emission=RGB(0, 0, 0), Transparency=0.5, Shine=100)  # disabled
create_material_19 = CreateMaterial(Diffuse=RGB(178, 178, 178), Specular=RGB(0, 255, 255), Emission=RGB(0, 0, 0), Transparency=0.5, Shine=100)  # disabled
quick_graph_9 = QuickGraph(shift_list_64, SortOrder=0)  # disabled

create_material_20 = CreateMaterial(Diffuse=RGB(161, 161, 161), Specular=RGB(0, 255, 255), Emission=RGB(0, 0, 0), Transparency=0.5, Shine=100)  # disabled
create_material_21 = CreateMaterial(Diffuse=RGB(186, 186, 186), Specular=RGB(0, 255, 255), Emission=RGB(0, 0, 0), Transparency=0.5, Shine=100)  # disabled
quick_graph_10 = QuickGraph(shift_list_63, SortOrder=0)  # disabled

create_material_22 = CreateMaterial(Diffuse=RGB(195, 195, 195), Specular=RGB(0, 255, 255), Emission=RGB(0, 0, 0), Transparency=0.5, Shine=100)
create_material_23 = CreateMaterial(Diffuse=RGB(220, 220, 220), Specular=RGB(0, 255, 255), Emission=RGB(0, 0, 0), Transparency=0.5, Shine=100)
quick_graph_11 = QuickGraph(shift_list_62, SortOrder=0)

create_material_24 = CreateMaterial(Diffuse=RGB(199, 199, 199), Specular=RGB(0, 255, 255), Emission=RGB(0, 0, 0), Transparency=0.5, Shine=100)
create_material_25 = CreateMaterial(Diffuse=RGB(224, 224, 224), Specular=RGB(0, 255, 255), Emission=RGB(0, 0, 0), Transparency=0.5, Shine=100)
quick_graph_12 = QuickGraph(shift_list_61, SortOrder=0)

create_material_26 = CreateMaterial(Diffuse=RGB(203, 203, 203), Specular=RGB(0, 255, 255), Emission=RGB(0, 0, 0), Transparency=0.5, Shine=100)
create_material_27 = CreateMaterial(Diffuse=RGB(228, 228, 228), Specular=RGB(0, 255, 255), Emission=RGB(0, 0, 0), Transparency=0.5, Shine=100)
quick_graph_13 = QuickGraph(shift_list_60, SortOrder=0)

create_material_28 = CreateMaterial(Diffuse=RGB(207, 207, 207), Specular=RGB(0, 255, 255), Emission=RGB(0, 0, 0), Transparency=0.5, Shine=100)
create_material_29 = CreateMaterial(Diffuse=RGB(232, 232, 232), Specular=RGB(0, 255, 255), Emission=RGB(0, 0, 0), Transparency=0.5, Shine=100)
quick_graph_14 = QuickGraph(shift_list_59, SortOrder=0)

create_material_30 = CreateMaterial(Diffuse=RGB(211, 211, 211), Specular=RGB(0, 255, 255), Emission=RGB(0, 0, 0), Transparency=0.5, Shine=100)
create_material_31 = CreateMaterial(Diffuse=RGB(236, 236, 236), Specular=RGB(0, 255, 255), Emission=RGB(0, 0, 0), Transparency=0.5, Shine=100)
quick_graph_15 = QuickGraph(shift_list_58, SortOrder=0)

create_material_32 = CreateMaterial(Diffuse=RGB(215, 215, 215), Specular=RGB(0, 255, 255), Emission=RGB(0, 0, 0), Transparency=0.5, Shine=100)
create_material_33 = CreateMaterial(Diffuse=RGB(240, 240, 240), Specular=RGB(0, 255, 255), Emission=RGB(0, 0, 0), Transparency=0.5, Shine=100)
quick_graph_16 = QuickGraph(shift_list_57, SortOrder=0)

create_material_34 = CreateMaterial(Diffuse=RGB(219, 219, 219), Specular=RGB(0, 255, 255), Emission=RGB(0, 0, 0), Transparency=0.5, Shine=100)
create_material_35 = CreateMaterial(Diffuse=RGB(244, 244, 244), Specular=RGB(0, 255, 255), Emission=RGB(0, 0, 0), Transparency=0.5, Shine=100)
quick_graph_17 = QuickGraph(shift_list_56, SortOrder=0)
line_sdl_3 = LineSDL(Start=evaluate_length_12.Point, Direction=line_3, Length=expr("ABS(X)", multiplication_9))

end_points_7 = EndPoints(Curve=line_sdl_3)  # -> Start, End
pull_point_4 = PullPoint(Point=end_points_7.Start, Geometry=surface, ClosestOnly=True)  # -> ClosestPoint, Distance
pull_point_5 = PullPoint(Point=end_points_7.End, Geometry=surface, ClosestOnly=True)  # -> ClosestPoint, Distance
line_4 = Line(StartPoint=pull_point_4.ClosestPoint, EndPoint=pull_point_5.ClosestPoint)

pull_curve_3 = PullCurve(Curve=line_sdl_3, Surface=surface)  # disabled
stream_filter_4 = StreamFilter(Gate=gate_not, Stream0=line_sdl_3, Stream1=line_4)

curwe_curwature_first_diference_comb_sca = CURWECURWATUREFIRSTDIFERENCECOMBSCALEDLINES(stream_filter_4)  # CURWE CURWATURE FIRST DIFERENCE COMB SCALED LINES
evaluate_length_13 = EvaluateLength(Curve=stream_filter_4, Length=1, Normalized=True)  # -> Point, Tangent, Parameter
custom_preview_4 = CustomPreview(Geometry=stream_filter_4, Material=create_material_35)

pull_point_6 = PullPoint(Point=evaluate_length_13.Point, Geometry=surface, ClosestOnly=True)  # -> ClosestPoint, Distance
stream_filter_5 = StreamFilter(Gate=gate_not, Stream0=evaluate_length_13.Point, Stream1=pull_point_6.ClosestPoint)

interpolate_13 = Interpolate(Vertices=stream_filter_5, Degree=1, Periodic=False, KnotStyle=2)  # -> Curve, Length, Domain
custom_preview_5 = CustomPreview(Geometry=interpolate_13.Curve, Material=create_material_34)

explode_2 = Explode(Curve=interpolate_13.Curve, Recursive=True)  # -> Segments, Vertices
evaluate_length_14 = EvaluateLength(Curve=explode_2.Segments, Length=0.5, Normalized=True)  # -> Point, Tangent, Parameter
curve_closest_point_2 = CurveClosestPoint(Point=evaluate_length_14.Point, Curve=curve_34)  # -> Point, Parameter, Distance
line_5 = Line(StartPoint=curve_closest_point_2.Point, EndPoint=evaluate_length_14.Point)

line_sdl_4 = LineSDL(Start=evaluate_length_14.Point, Direction=line_5, Length=expr("ABS(X)", multiplication_39))

end_points_8 = EndPoints(Curve=line_sdl_4)  # -> Start, End
pull_point_7 = PullPoint(Point=end_points_8.Start, Geometry=surface, ClosestOnly=True)  # -> ClosestPoint, Distance
pull_point_8 = PullPoint(Point=end_points_8.End, Geometry=surface, ClosestOnly=True)  # -> ClosestPoint, Distance
line_6 = Line(StartPoint=pull_point_7.ClosestPoint, EndPoint=pull_point_8.ClosestPoint)

stream_filter_6 = StreamFilter(Gate=gate_not, Stream0=line_sdl_4, Stream1=line_6)
curwe_curwature_second_diference_combs = CURWECURWATURESECONDDIFERENCECOMBS(stream_filter_6)  # CURWE CURWATURE SECOND DIFERENCE COMBS
pull_curve_4 = PullCurve(Curve=line_sdl_4, Surface=surface)  # disabled

evaluate_length_15 = EvaluateLength(Curve=stream_filter_6, Length=1, Normalized=True)  # -> Point, Tangent, Parameter
custom_preview_6 = CustomPreview(Geometry=stream_filter_6, Material=create_material_33)

pull_point_9 = PullPoint(Point=evaluate_length_15.Point, Geometry=surface, ClosestOnly=True)  # -> ClosestPoint, Distance
stream_filter_7 = StreamFilter(Gate=gate_not, Stream0=evaluate_length_15.Point, Stream1=pull_point_9.ClosestPoint)

interpolate_14 = Interpolate(Vertices=stream_filter_7, Degree=1, Periodic=False, KnotStyle=2)  # -> Curve, Length, Domain
custom_preview_7 = CustomPreview(Geometry=interpolate_14.Curve, Material=create_material_32)

explode_3 = Explode(Curve=interpolate_14.Curve, Recursive=True)  # -> Segments, Vertices
evaluate_length_16 = EvaluateLength(Curve=explode_3.Segments, Length=0.5, Normalized=True)  # -> Point, Tangent, Parameter
curve_closest_point_3 = CurveClosestPoint(Point=evaluate_length_16.Point, Curve=curve_34)  # -> Point, Parameter, Distance
line_7 = Line(StartPoint=curve_closest_point_3.Point, EndPoint=evaluate_length_16.Point)

line_sdl_5 = LineSDL(Start=evaluate_length_16.Point, Direction=line_7, Length=expr("ABS(X)", multiplication_37))

pull_curve_5 = PullCurve(Curve=line_sdl_5, Surface=surface)  # disabled

end_points_9 = EndPoints(Curve=line_sdl_5)  # -> Start, End
pull_point_10 = PullPoint(Point=end_points_9.Start, Geometry=surface, ClosestOnly=True)  # -> ClosestPoint, Distance
pull_point_11 = PullPoint(Point=end_points_9.End, Geometry=surface, ClosestOnly=True)  # -> ClosestPoint, Distance
line_8 = Line(StartPoint=pull_point_10.ClosestPoint, EndPoint=pull_point_11.ClosestPoint)

stream_filter_8 = StreamFilter(Gate=gate_not, Stream0=line_sdl_5, Stream1=line_8)
curwe_curwature_third_diference_combs = CURWECURWATURETHIRDDIFERENCECOMBS(stream_filter_8)  # CURWE CURWATURE THIRD DIFERENCE COMBS

evaluate_length_17 = EvaluateLength(Curve=stream_filter_8, Length=1, Normalized=True)  # -> Point, Tangent, Parameter
custom_preview_8 = CustomPreview(Geometry=stream_filter_8, Material=create_material_31)

pull_point_12 = PullPoint(Point=evaluate_length_17.Point, Geometry=surface, ClosestOnly=True)  # -> ClosestPoint, Distance
stream_filter_9 = StreamFilter(Gate=gate_not, Stream0=evaluate_length_17.Point, Stream1=pull_point_12.ClosestPoint)

interpolate_15 = Interpolate(Vertices=stream_filter_9, Degree=1, Periodic=False, KnotStyle=2)  # -> Curve, Length, Domain
custom_preview_9 = CustomPreview(Geometry=interpolate_15.Curve, Material=create_material_30)

explode_4 = Explode(Curve=interpolate_15.Curve, Recursive=True)  # -> Segments, Vertices
evaluate_length_18 = EvaluateLength(Curve=explode_4.Segments, Length=0.5, Normalized=True)  # -> Point, Tangent, Parameter
curve_closest_point_4 = CurveClosestPoint(Point=evaluate_length_18.Point, Curve=curve_34)  # -> Point, Parameter, Distance
line_9 = Line(StartPoint=curve_closest_point_4.Point, EndPoint=evaluate_length_18.Point)

line_sdl_6 = LineSDL(Start=evaluate_length_18.Point, Direction=line_9, Length=expr("ABS(X)", multiplication_35))

end_points_10 = EndPoints(Curve=line_sdl_6)  # -> Start, End
pull_point_13 = PullPoint(Point=end_points_10.Start, Geometry=surface, ClosestOnly=True)  # -> ClosestPoint, Distance
pull_point_14 = PullPoint(Point=end_points_10.End, Geometry=surface, ClosestOnly=True)  # -> ClosestPoint, Distance
line_10 = Line(StartPoint=pull_point_13.ClosestPoint, EndPoint=pull_point_14.ClosestPoint)

stream_filter_10 = StreamFilter(Gate=gate_not, Stream0=line_sdl_6, Stream1=line_10)

evaluate_length_19 = EvaluateLength(Curve=stream_filter_10, Length=1, Normalized=True)  # -> Point, Tangent, Parameter
custom_preview_10 = CustomPreview(Geometry=stream_filter_10, Material=create_material_29)

pull_point_15 = PullPoint(Point=evaluate_length_19.Point, Geometry=surface, ClosestOnly=True)  # -> ClosestPoint, Distance
stream_filter_11 = StreamFilter(Gate=gate_not, Stream0=evaluate_length_19.Point, Stream1=pull_point_15.ClosestPoint)

interpolate_16 = Interpolate(Vertices=stream_filter_11, Degree=1, Periodic=False, KnotStyle=2)  # -> Curve, Length, Domain
custom_preview_11 = CustomPreview(Geometry=interpolate_16.Curve, Material=create_material_28)

explode_5 = Explode(Curve=interpolate_16.Curve, Recursive=True)  # -> Segments, Vertices
evaluate_length_20 = EvaluateLength(Curve=explode_5.Segments, Length=0.5, Normalized=True)  # -> Point, Tangent, Parameter
curve_closest_point_5 = CurveClosestPoint(Point=evaluate_length_20.Point, Curve=curve_34)  # -> Point, Parameter, Distance
line_11 = Line(StartPoint=curve_closest_point_5.Point, EndPoint=evaluate_length_20.Point)

line_sdl_7 = LineSDL(Start=evaluate_length_20.Point, Direction=line_11, Length=expr("ABS(X)", multiplication_33))

end_points_11 = EndPoints(Curve=line_sdl_7)  # -> Start, End
pull_point_16 = PullPoint(Point=end_points_11.Start, Geometry=surface, ClosestOnly=True)  # -> ClosestPoint, Distance
pull_point_17 = PullPoint(Point=end_points_11.End, Geometry=surface, ClosestOnly=True)  # -> ClosestPoint, Distance
line_12 = Line(StartPoint=pull_point_16.ClosestPoint, EndPoint=pull_point_17.ClosestPoint)
stream_filter_12 = StreamFilter(Gate=gate_not, Stream0=line_sdl_7, Stream1=line_12)

evaluate_length_21 = EvaluateLength(Curve=stream_filter_12, Length=1, Normalized=True)  # -> Point, Tangent, Parameter
custom_preview_12 = CustomPreview(Geometry=stream_filter_12, Material=create_material_27)

pull_point_18 = PullPoint(Point=evaluate_length_21.Point, Geometry=surface, ClosestOnly=True)  # -> ClosestPoint, Distance
stream_filter_13 = StreamFilter(Gate=gate_not, Stream0=evaluate_length_21.Point, Stream1=pull_point_18.ClosestPoint)

interpolate_17 = Interpolate(Vertices=stream_filter_13, Degree=1, Periodic=False, KnotStyle=2)  # -> Curve, Length, Domain
custom_preview_13 = CustomPreview(Geometry=interpolate_17.Curve, Material=create_material_26)

explode_6 = Explode(Curve=interpolate_17.Curve, Recursive=True)  # -> Segments, Vertices
evaluate_length_22 = EvaluateLength(Curve=explode_6.Segments, Length=0.5, Normalized=True)  # -> Point, Tangent, Parameter
curve_closest_point_6 = CurveClosestPoint(Point=evaluate_length_22.Point, Curve=curve_34)  # -> Point, Parameter, Distance
line_13 = Line(StartPoint=curve_closest_point_6.Point, EndPoint=evaluate_length_22.Point)

line_sdl_8 = LineSDL(Start=evaluate_length_22.Point, Direction=line_13, Length=expr("ABS(X)", multiplication_31))

end_points_12 = EndPoints(Curve=line_sdl_8)  # -> Start, End
pull_point_19 = PullPoint(Point=end_points_12.Start, Geometry=surface, ClosestOnly=True)  # -> ClosestPoint, Distance
pull_point_20 = PullPoint(Point=end_points_12.End, Geometry=surface, ClosestOnly=True)  # -> ClosestPoint, Distance
line_14 = Line(StartPoint=pull_point_19.ClosestPoint, EndPoint=pull_point_20.ClosestPoint)
stream_filter_14 = StreamFilter(Gate=gate_not, Stream0=line_sdl_8, Stream1=line_14)

evaluate_length_23 = EvaluateLength(Curve=stream_filter_14, Length=1, Normalized=True)  # -> Point, Tangent, Parameter
custom_preview_14 = CustomPreview(Geometry=stream_filter_14, Material=create_material_25)

pull_point_21 = PullPoint(Point=evaluate_length_23.Point, Geometry=surface, ClosestOnly=True)  # -> ClosestPoint, Distance
stream_filter_15 = StreamFilter(Gate=gate_not, Stream0=evaluate_length_23.Point, Stream1=pull_point_21.ClosestPoint)

interpolate_18 = Interpolate(Vertices=stream_filter_15, Degree=1, Periodic=False, KnotStyle=2)  # -> Curve, Length, Domain
custom_preview_15 = CustomPreview(Geometry=interpolate_18.Curve, Material=create_material_24)

explode_7 = Explode(Curve=interpolate_18.Curve, Recursive=True)  # -> Segments, Vertices
evaluate_length_24 = EvaluateLength(Curve=explode_7.Segments, Length=0.5, Normalized=True)  # -> Point, Tangent, Parameter
curve_closest_point_7 = CurveClosestPoint(Point=evaluate_length_24.Point, Curve=curve_34)  # -> Point, Parameter, Distance
line_15 = Line(StartPoint=curve_closest_point_7.Point, EndPoint=evaluate_length_24.Point)

line_sdl_9 = LineSDL(Start=evaluate_length_24.Point, Direction=line_15, Length=expr("ABS(X)", multiplication_29))

end_points_13 = EndPoints(Curve=line_sdl_9)  # -> Start, End
pull_point_22 = PullPoint(Point=end_points_13.Start, Geometry=surface, ClosestOnly=True)  # -> ClosestPoint, Distance
pull_point_23 = PullPoint(Point=end_points_13.End, Geometry=surface, ClosestOnly=True)  # -> ClosestPoint, Distance
line_16 = Line(StartPoint=pull_point_22.ClosestPoint, EndPoint=pull_point_23.ClosestPoint)
stream_filter_16 = StreamFilter(Gate=gate_not, Stream0=line_sdl_9, Stream1=line_16)

evaluate_length_25 = EvaluateLength(Curve=stream_filter_16, Length=1, Normalized=True)  # -> Point, Tangent, Parameter
custom_preview_16 = CustomPreview(Geometry=stream_filter_16, Material=create_material_23)

pull_point_24 = PullPoint(Point=evaluate_length_25.Point, Geometry=surface, ClosestOnly=True)  # -> ClosestPoint, Distance
stream_filter_17 = StreamFilter(Gate=gate_not, Stream0=evaluate_length_25.Point, Stream1=pull_point_24.ClosestPoint)

interpolate_19 = Interpolate(Vertices=stream_filter_17, Degree=1, Periodic=False, KnotStyle=2)  # -> Curve, Length, Domain
custom_preview_17 = CustomPreview(Geometry=interpolate_19.Curve, Material=create_material_22)

explode_8 = Explode(Curve=interpolate_19.Curve, Recursive=True)  # -> Segments, Vertices; disabled
evaluate_length_26 = EvaluateLength(Curve=explode_8.Segments, Length=0.5, Normalized=True)  # -> Point, Tangent, Parameter; disabled
curve_closest_point_8 = CurveClosestPoint(Point=evaluate_length_26.Point, Curve=curve_34)  # -> Point, Parameter, Distance; disabled
line_17 = Line(StartPoint=curve_closest_point_8.Point, EndPoint=evaluate_length_26.Point)  # disabled

line_sdl_10 = LineSDL(Start=evaluate_length_26.Point, Direction=line_17, Length=expr("ABS(X)", multiplication_27))  # disabled
evaluate_length_27 = EvaluateLength(Curve=line_sdl_10, Length=1, Normalized=True)  # -> Point, Tangent, Parameter; disabled
interpolate_20 = Interpolate(Vertices=evaluate_length_27.Point, Degree=1, Periodic=False, KnotStyle=2)  # -> Curve, Length, Domain; disabled
custom_preview_18 = CustomPreview(Geometry=interpolate_20.Curve, Material=create_material_20)  # disabled
custom_preview_19 = CustomPreview(Geometry=line_sdl_10, Material=create_material_21)  # disabled

explode_9 = Explode(Curve=interpolate_20.Curve, Recursive=True)  # -> Segments, Vertices; disabled
evaluate_length_28 = EvaluateLength(Curve=explode_9.Segments, Length=0.5, Normalized=True)  # -> Point, Tangent, Parameter; disabled
curve_closest_point_9 = CurveClosestPoint(Point=evaluate_length_28.Point, Curve=curve_34)  # -> Point, Parameter, Distance; disabled
line_18 = Line(StartPoint=curve_closest_point_9.Point, EndPoint=evaluate_length_28.Point)  # disabled

line_sdl_11 = LineSDL(Start=evaluate_length_28.Point, Direction=line_18, Length=expr("ABS(X)", multiplication_25))  # disabled
evaluate_length_29 = EvaluateLength(Curve=line_sdl_11, Length=1, Normalized=True)  # -> Point, Tangent, Parameter; disabled
interpolate_21 = Interpolate(Vertices=evaluate_length_29.Point, Degree=1, Periodic=False, KnotStyle=2)  # -> Curve, Length, Domain; disabled
custom_preview_20 = CustomPreview(Geometry=interpolate_21.Curve, Material=create_material_18)  # disabled
custom_preview_21 = CustomPreview(Geometry=line_sdl_11, Material=create_material_19)  # disabled

explode_10 = Explode(Curve=interpolate_21.Curve, Recursive=True)  # -> Segments, Vertices; disabled
evaluate_length_30 = EvaluateLength(Curve=explode_10.Segments, Length=0.5, Normalized=True)  # -> Point, Tangent, Parameter; disabled
curve_closest_point_10 = CurveClosestPoint(Point=evaluate_length_30.Point, Curve=curve_34)  # -> Point, Parameter, Distance; disabled
line_19 = Line(StartPoint=curve_closest_point_10.Point, EndPoint=evaluate_length_30.Point)  # disabled

line_sdl_12 = LineSDL(Start=evaluate_length_30.Point, Direction=line_19, Length=expr("ABS(X)", multiplication_23))  # disabled
evaluate_length_31 = EvaluateLength(Curve=line_sdl_12, Length=1, Normalized=True)  # -> Point, Tangent, Parameter; disabled
interpolate_22 = Interpolate(Vertices=evaluate_length_31.Point, Degree=1, Periodic=False, KnotStyle=2)  # -> Curve, Length, Domain; disabled
custom_preview_22 = CustomPreview(Geometry=interpolate_22.Curve, Material=create_material_16)  # disabled
custom_preview_23 = CustomPreview(Geometry=line_sdl_12, Material=create_material_17)  # disabled

explode_11 = Explode(Curve=interpolate_22.Curve, Recursive=True)  # -> Segments, Vertices; disabled
evaluate_length_32 = EvaluateLength(Curve=explode_11.Segments, Length=0.5, Normalized=True)  # -> Point, Tangent, Parameter; disabled
curve_closest_point_11 = CurveClosestPoint(Point=evaluate_length_32.Point, Curve=curve_34)  # -> Point, Parameter, Distance; disabled
line_20 = Line(StartPoint=curve_closest_point_11.Point, EndPoint=evaluate_length_32.Point)  # disabled

line_sdl_13 = LineSDL(Start=evaluate_length_32.Point, Direction=line_20, Length=expr("ABS(X)", multiplication_21))  # disabled
evaluate_length_33 = EvaluateLength(Curve=line_sdl_13, Length=1, Normalized=True)  # -> Point, Tangent, Parameter; disabled
interpolate_23 = Interpolate(Vertices=evaluate_length_33.Point, Degree=1, Periodic=False, KnotStyle=2)  # -> Curve, Length, Domain; disabled
custom_preview_24 = CustomPreview(Geometry=interpolate_23.Curve, Material=create_material_14)  # disabled
custom_preview_25 = CustomPreview(Geometry=line_sdl_13, Material=create_material_15)  # disabled

explode_12 = Explode(Curve=interpolate_23.Curve, Recursive=True)  # -> Segments, Vertices; disabled
evaluate_length_34 = EvaluateLength(Curve=explode_12.Segments, Length=0.5, Normalized=True)  # -> Point, Tangent, Parameter; disabled
curve_closest_point_12 = CurveClosestPoint(Point=evaluate_length_34.Point, Curve=curve_34)  # -> Point, Parameter, Distance; disabled
line_21 = Line(StartPoint=curve_closest_point_12.Point, EndPoint=evaluate_length_34.Point)  # disabled

line_sdl_14 = LineSDL(Start=evaluate_length_34.Point, Direction=line_21, Length=expr("ABS(X)", multiplication_19))  # disabled
evaluate_length_35 = EvaluateLength(Curve=line_sdl_14, Length=1, Normalized=True)  # -> Point, Tangent, Parameter; disabled
interpolate_24 = Interpolate(Vertices=evaluate_length_35.Point, Degree=1, Periodic=False, KnotStyle=2)  # -> Curve, Length, Domain; disabled
custom_preview_26 = CustomPreview(Geometry=interpolate_24.Curve, Material=create_material_12)  # disabled
custom_preview_27 = CustomPreview(Geometry=line_sdl_14, Material=create_material_13)  # disabled

explode_13 = Explode(Curve=interpolate_24.Curve, Recursive=True)  # -> Segments, Vertices; disabled
evaluate_length_36 = EvaluateLength(Curve=explode_13.Segments, Length=0.5, Normalized=True)  # -> Point, Tangent, Parameter; disabled
curve_closest_point_13 = CurveClosestPoint(Point=evaluate_length_36.Point, Curve=curve_34)  # -> Point, Parameter, Distance; disabled
line_22 = Line(StartPoint=curve_closest_point_13.Point, EndPoint=evaluate_length_36.Point)  # disabled

line_sdl_15 = LineSDL(Start=evaluate_length_36.Point, Direction=line_22, Length=expr("ABS(X)", multiplication_17))  # disabled
evaluate_length_37 = EvaluateLength(Curve=line_sdl_15, Length=1, Normalized=True)  # -> Point, Tangent, Parameter; disabled
interpolate_25 = Interpolate(Vertices=evaluate_length_37.Point, Degree=1, Periodic=False, KnotStyle=2)  # -> Curve, Length, Domain; disabled
custom_preview_28 = CustomPreview(Geometry=interpolate_25.Curve, Material=create_material_10)  # disabled
custom_preview_29 = CustomPreview(Geometry=line_sdl_15, Material=create_material_11)  # disabled

explode_14 = Explode(Curve=interpolate_25.Curve, Recursive=True)  # -> Segments, Vertices; disabled
evaluate_length_38 = EvaluateLength(Curve=explode_14.Segments, Length=0.5, Normalized=True)  # -> Point, Tangent, Parameter; disabled
curve_closest_point_14 = CurveClosestPoint(Point=evaluate_length_38.Point, Curve=curve_34)  # -> Point, Parameter, Distance; disabled
line_23 = Line(StartPoint=curve_closest_point_14.Point, EndPoint=evaluate_length_38.Point)  # disabled

line_sdl_16 = LineSDL(Start=evaluate_length_38.Point, Direction=line_23, Length=expr("ABS(X)", multiplication_15))  # disabled
evaluate_length_39 = EvaluateLength(Curve=line_sdl_16, Length=1, Normalized=True)  # -> Point, Tangent, Parameter; disabled
interpolate_26 = Interpolate(Vertices=evaluate_length_39.Point, Degree=1, Periodic=False, KnotStyle=2)  # -> Curve, Length, Domain; disabled
custom_preview_30 = CustomPreview(Geometry=interpolate_26.Curve, Material=create_material_8)  # disabled
custom_preview_31 = CustomPreview(Geometry=line_sdl_16, Material=create_material_9)  # disabled

explode_15 = Explode(Curve=interpolate_26.Curve, Recursive=True)  # -> Segments, Vertices; disabled
evaluate_length_40 = EvaluateLength(Curve=explode_15.Segments, Length=0.5, Normalized=True)  # -> Point, Tangent, Parameter; disabled
curve_closest_point_15 = CurveClosestPoint(Point=evaluate_length_40.Point, Curve=curve_34)  # -> Point, Parameter, Distance; disabled
line_24 = Line(StartPoint=curve_closest_point_15.Point, EndPoint=evaluate_length_40.Point)  # disabled

line_sdl_17 = LineSDL(Start=evaluate_length_40.Point, Direction=line_24, Length=expr("ABS(X)", multiplication_13))  # disabled
evaluate_length_41 = EvaluateLength(Curve=line_sdl_17, Length=1, Normalized=True)  # -> Point, Tangent, Parameter; disabled
interpolate_27 = Interpolate(Vertices=evaluate_length_41.Point, Degree=1, Periodic=False, KnotStyle=2)  # -> Curve, Length, Domain; disabled
custom_preview_32 = CustomPreview(Geometry=interpolate_27.Curve, Material=create_material_6)  # disabled
custom_preview_33 = CustomPreview(Geometry=line_sdl_17, Material=create_material_7)  # disabled

explode_16 = Explode(Curve=interpolate_27.Curve, Recursive=True)  # -> Segments, Vertices; disabled
evaluate_length_42 = EvaluateLength(Curve=explode_16.Segments, Length=0.5, Normalized=True)  # -> Point, Tangent, Parameter; disabled
curve_closest_point_16 = CurveClosestPoint(Point=evaluate_length_42.Point, Curve=curve_34)  # -> Point, Parameter, Distance; disabled
line_25 = Line(StartPoint=curve_closest_point_16.Point, EndPoint=evaluate_length_42.Point)  # disabled

line_sdl_18 = LineSDL(Start=evaluate_length_42.Point, Direction=line_25, Length=expr("ABS(X)", multiplication_11))  # disabled
evaluate_length_43 = EvaluateLength(Curve=line_sdl_18, Length=1, Normalized=True)  # -> Point, Tangent, Parameter; disabled
interpolate_28 = Interpolate(Vertices=evaluate_length_43.Point, Degree=1, Periodic=False, KnotStyle=2)  # -> Curve, Length, Domain; disabled
custom_preview_34 = CustomPreview(Geometry=interpolate_28.Curve, Material=create_material_4)  # disabled
custom_preview_35 = CustomPreview(Geometry=line_sdl_18, Material=create_material_5)  # disabled

# ==== cluster DIFERENCECURWATURESHAPEDGRAPH
curve = ClusterInput()

digit_scroller = DigitScroller(Scroller_Digits=12, Scroller_Prefix=" ", Scroller_Radix=11, Scroller_Value=87)  # disabled
create_material = CreateMaterial(Diffuse=RGB(222, 222, 222), Specular=RGB(0, 255, 255), Emission=RGB(0, 0, 0), Transparency=0.5, Shine=100)
create_material_2 = CreateMaterial(Diffuse=RGB(247, 247, 247), Specular=RGB(0, 255, 255), Emission=RGB(0, 0, 0), Transparency=0.5, Shine=100)
create_material_3 = CreateMaterial(Diffuse=RGB(176, 176, 176), Specular=RGB(0, 255, 255), Emission=RGB(0, 0, 0), Transparency=0.5, Shine=100)
count = ClusterInput()
curve_2 = Curve(graft(curve))
divide_curve = DivideCurve(Curve=curve_2, Count=count, Kinks=False)  # -> Points, Tangents, Parameters
curvature = Curvature(Curve=curve_2, Parameter=divide_curve.Parameters)  # -> Point, Curvature, Curvature_2
deconstruct_arc = DeconstructArc(Arc=curvature.Curvature_2)  # -> BasePlane, Radius, Angle
line = Line(StartPoint=curvature.Point, EndPoint=deconstruct_arc.BasePlane)
control_points = ControlPoints(Curve=curve_2)  # -> Points, Weights, Knots
list_length = ListLength(List=control_points.Points)  # -> expr("X-1", Length)
curve_degree = CurveDegree(Curve=curve_2)
expression = Expression(A=list_length, B=curve_degree, Expression="A-B+1")
length = Length(Curve=curve_2)
one_over_x = OneOverX(Value=deconstruct_arc.Radius)
quick_graph = QuickGraph(one_over_x, SortOrder=0)
format = Format(Format="{0:R}", Culture=127, Data0=one_over_x)  # disabled
panel = Panel(format)
bounds = Bounds(Numbers=one_over_x)
remap_numbers = RemapNumbers(Value=one_over_x, Source=bounds, Target=Domain(0, 1))  # -> Mapped, Clipped
curvature_graph = CurvatureGraph(Curve=curve_2, Density=1, Scale=digit_scroller)  # disabled
custom_preview = CustomPreview(Geometry=curve_2, Material=create_material_3)
multiplication = Multiplication(A=length, B=remap_numbers.Mapped)
B = ClusterInput()
multiplication_2 = Multiplication(A=multiplication, B=B)
line_sdl = LineSDL(Start=curvature.Point, Direction=curvature.Curvature, Length=expr("-X", multiplication_2))
evaluate_length = EvaluateLength(Curve=line_sdl, Length=1, Normalized=True)  # -> Point, Tangent, Parameter
interpolate = Interpolate(Vertices=evaluate_length.Point, Degree=1, Periodic=False, KnotStyle=2)  # -> Curve, Length, Domain
custom_preview_2 = CustomPreview(Geometry=line_sdl, Material=create_material_2)
relay = ClusterOutput(one_over_x)
curve_3 = Curve(interpolate.Curve)
custom_preview_3 = CustomPreview(Geometry=curve_3, Material=create_material)
number = Number(expression)
number_2 = Number(number)

replace_nulls = ReplaceNulls(Items=one_over_x, Replacements=0)  # -> Items, Count
relative_differences = RelativeDifferences(Values=replace_nulls.Items)
shift_list = ShiftList(List=relative_differences, Shift=1, Wrap=False)

replace_nulls_2 = ReplaceNulls(Items=shift_list, Replacements=0)  # -> Items, Count
relative_differences_2 = RelativeDifferences(Values=replace_nulls_2.Items)
shift_list_2 = ShiftList(List=relative_differences_2, Shift=1, Wrap=False)

replace_nulls_3 = ReplaceNulls(Items=shift_list_2, Replacements=0)  # -> Items, Count
relative_differences_3 = RelativeDifferences(Values=replace_nulls_3.Items)
shift_list_3 = ShiftList(List=relative_differences_3, Shift=1, Wrap=False)

replace_nulls_4 = ReplaceNulls(Items=shift_list_3, Replacements=0)  # -> Items, Count
relative_differences_4 = RelativeDifferences(Values=replace_nulls_4.Items)
shift_list_4 = ShiftList(List=relative_differences_4, Shift=1, Wrap=False)

replace_nulls_5 = ReplaceNulls(Items=shift_list_4, Replacements=0)  # -> Items, Count
relative_differences_5 = RelativeDifferences(Values=replace_nulls_5.Items)
shift_list_5 = ShiftList(List=relative_differences_5, Shift=1, Wrap=False)

expression_2 = Expression(O=shift_list_5, Expression="FORMAT(\"{0:R}\",O)")  # disabled
format_2 = Format(Format="{0:R}", Culture=127, Data0=shift_list_5)  # disabled
panel_2 = Panel(format_2)
relay_2 = ClusterOutput(shift_list_5)

replace_nulls_6 = ReplaceNulls(Items=shift_list_5, Replacements=0)  # -> Items, Count
relative_differences_6 = RelativeDifferences(Values=replace_nulls_6.Items)
shift_list_6 = ShiftList(List=relative_differences_6, Shift=1, Wrap=False)

replace_nulls_7 = ReplaceNulls(Items=shift_list_6, Replacements=0)  # -> Items, Count
relative_differences_7 = RelativeDifferences(Values=replace_nulls_7.Items)
shift_list_7 = ShiftList(List=relative_differences_7, Shift=1, Wrap=False)

replace_nulls_8 = ReplaceNulls(Items=shift_list_7, Replacements=0)  # -> Items, Count
relative_differences_8 = RelativeDifferences(Values=replace_nulls_8.Items)
shift_list_8 = ShiftList(List=relative_differences_8, Shift=1, Wrap=False)

replace_nulls_9 = ReplaceNulls(Items=shift_list_8, Replacements=0)  # -> Items, Count
relative_differences_9 = RelativeDifferences(Values=replace_nulls_9.Items)
shift_list_9 = ShiftList(List=relative_differences_9, Shift=1, Wrap=False)

replace_nulls_10 = ReplaceNulls(Items=shift_list_9, Replacements=0)  # -> Items, Count
relative_differences_10 = RelativeDifferences(Values=replace_nulls_10.Items)
shift_list_10 = ShiftList(List=relative_differences_10, Shift=1, Wrap=False)

replace_nulls_11 = ReplaceNulls(Items=shift_list_10, Replacements=0)  # -> Items, Count
relative_differences_11 = RelativeDifferences(Values=replace_nulls_11.Items)
shift_list_11 = ShiftList(List=relative_differences_11, Shift=1, Wrap=False)

replace_nulls_12 = ReplaceNulls(Items=shift_list_11, Replacements=0)  # -> Items, Count
relative_differences_12 = RelativeDifferences(Values=replace_nulls_12.Items)
shift_list_12 = ShiftList(List=relative_differences_12, Shift=1, Wrap=False)

replace_nulls_13 = ReplaceNulls(Items=shift_list_12, Replacements=0)  # -> Items, Count
relative_differences_13 = RelativeDifferences(Values=replace_nulls_13.Items)
shift_list_13 = ShiftList(List=relative_differences_13, Shift=1, Wrap=False)

replace_nulls_14 = ReplaceNulls(Items=shift_list_13, Replacements=0)  # -> Items, Count
relative_differences_14 = RelativeDifferences(Values=replace_nulls_14.Items)
shift_list_14 = ShiftList(List=relative_differences_14, Shift=1, Wrap=False)

replace_nulls_15 = ReplaceNulls(Items=shift_list_14, Replacements=0)  # -> Items, Count
relative_differences_15 = RelativeDifferences(Values=replace_nulls_15.Items)
shift_list_15 = ShiftList(List=relative_differences_15, Shift=1, Wrap=False)

replace_nulls_16 = ReplaceNulls(Items=shift_list_15, Replacements=0)  # -> Items, Count
relative_differences_16 = RelativeDifferences(Values=replace_nulls_16.Items)
shift_list_16 = ShiftList(List=relative_differences_16, Shift=1, Wrap=False)

format_3 = Format(Format="{0:R}", Culture=127, Data0=shift_list_16)  # disabled
panel_3 = Panel(format_3)
relay_3 = ClusterOutput(shift_list_16)

explode = Explode(Curve=curve_3, Recursive=True)  # -> Segments, Vertices
evaluate_length_2 = EvaluateLength(Curve=explode.Segments, Length=0.5, Normalized=True)  # -> Point, Tangent, Parameter
curve_closest_point = CurveClosestPoint(Point=evaluate_length_2.Point, Curve=curve_2)  # -> Point, Parameter, Distance
line_2 = Line(StartPoint=curve_closest_point.Point, EndPoint=evaluate_length_2.Point)

format_4 = Format(Format="{0:R}", Culture=127, Data0=shift_list_14)  # disabled
panel_4 = Panel(format_4)
relay_4 = ClusterOutput(shift_list_14)

format_5 = Format(Format="{0:R}", Culture=127, Data0=shift_list_13)  # disabled
panel_5 = Panel(format_5)
relay_5 = ClusterOutput(shift_list_13)

format_6 = Format(Format="{0:R}", Culture=127, Data0=shift_list_12)  # disabled
panel_6 = Panel(format_6)
relay_6 = ClusterOutput(shift_list_12)

format_7 = Format(Format="{0:R}", Culture=127, Data0=shift_list_11)  # disabled
panel_7 = Panel(format_7)
relay_7 = ClusterOutput(shift_list_11)

format_8 = Format(Format="{0:R}", Culture=127, Data0=shift_list_10)  # disabled
panel_8 = Panel(format_8)
relay_8 = ClusterOutput(shift_list_10)

format_9 = Format(Format="{0:R}", Culture=127, Data0=shift_list_9)  # disabled
panel_9 = Panel(format_9)
relay_9 = ClusterOutput(shift_list_9)

format_10 = Format(Format="{0:R}", Culture=127, Data0=shift_list_8)  # disabled
panel_10 = Panel(format_10)
relay_10 = ClusterOutput(shift_list_8)

format_11 = Format(Format="{0:R}", Culture=127, Data0=shift_list_7)  # disabled
panel_11 = Panel(format_11)
relay_11 = ClusterOutput(shift_list_7)

format_12 = Format(Format="{0:R}", Culture=127, Data0=shift_list_6)  # disabled
panel_12 = Panel(format_12)
relay_12 = ClusterOutput(shift_list_6)

format_13 = Format(Format="{0:R}", Culture=127, Data0=shift_list_4)  # disabled
panel_13 = Panel(format_13)
relay_13 = ClusterOutput(shift_list_4)

format_14 = Format(Format="{0:R}", Culture=127, Data0=shift_list_3)  # disabled
panel_14 = Panel(format_14)
relay_14 = ClusterOutput(shift_list_3)

format_15 = Format(Format="{0:R}", Culture=127, Data0=shift_list_2)  # disabled
panel_15 = Panel(format_15)
relay_15 = ClusterOutput(shift_list_2)

format_16 = Format(Format="{0:R}", Culture=127, Data0=shift_list)  # disabled
panel_16 = Panel(format_16)
relay_16 = ClusterOutput(shift_list)

format_17 = Format(Format="{0:R}", Culture=127, Data0=deconstruct_arc.Radius)  # disabled
panel_17 = Panel(format_17)

format_18 = Format(Format="{0:R}", Culture=127, Data0=shift_list_15)  # disabled
panel_18 = Panel(format_18)
relay_17 = ClusterOutput(shift_list_15)

bounds_2 = Bounds(Numbers=shift_list_16)
remap_numbers_2 = RemapNumbers(Value=shift_list_16, Source=bounds_2, Target=Domain(-1, 1))  # -> Mapped, Clipped
multiplication_3 = Multiplication(A=length, B=remap_numbers_2.Mapped)
B_2 = ClusterInput()
multiplication_4 = Multiplication(A=multiplication_3, B=B_2)

bounds_3 = Bounds(Numbers=shift_list_14)
remap_numbers_3 = RemapNumbers(Value=shift_list_14, Source=bounds_3, Target=Domain(-1, 1))  # -> Mapped, Clipped
multiplication_5 = Multiplication(A=length, B=remap_numbers_3.Mapped)
B_3 = ClusterInput()
multiplication_6 = Multiplication(A=multiplication_5, B=B_3)

bounds_4 = Bounds(Numbers=shift_list_13)
remap_numbers_4 = RemapNumbers(Value=shift_list_13, Source=bounds_4, Target=Domain(-1, 1))  # -> Mapped, Clipped
multiplication_7 = Multiplication(A=length, B=remap_numbers_4.Mapped)
B_4 = ClusterInput()
multiplication_8 = Multiplication(A=multiplication_7, B=B_4)

bounds_5 = Bounds(Numbers=shift_list_12)
remap_numbers_5 = RemapNumbers(Value=shift_list_12, Source=bounds_5, Target=Domain(-1, 1))  # -> Mapped, Clipped
multiplication_9 = Multiplication(A=length, B=remap_numbers_5.Mapped)
B_5 = ClusterInput()
multiplication_10 = Multiplication(A=multiplication_9, B=B_5)

bounds_6 = Bounds(Numbers=shift_list_11)
remap_numbers_6 = RemapNumbers(Value=shift_list_11, Source=bounds_6, Target=Domain(-1, 1))  # -> Mapped, Clipped
multiplication_11 = Multiplication(A=length, B=remap_numbers_6.Mapped)
B_6 = ClusterInput()
multiplication_12 = Multiplication(A=multiplication_11, B=B_6)

bounds_7 = Bounds(Numbers=shift_list_10)
remap_numbers_7 = RemapNumbers(Value=shift_list_10, Source=bounds_7, Target=Domain(-1, 1))  # -> Mapped, Clipped
multiplication_13 = Multiplication(A=length, B=remap_numbers_7.Mapped)
B_7 = ClusterInput()
multiplication_14 = Multiplication(A=multiplication_13, B=B_7)

bounds_8 = Bounds(Numbers=shift_list_9)
remap_numbers_8 = RemapNumbers(Value=shift_list_9, Source=bounds_8, Target=Domain(-1, 1))  # -> Mapped, Clipped
multiplication_15 = Multiplication(A=length, B=remap_numbers_8.Mapped)
B_8 = ClusterInput()
multiplication_16 = Multiplication(A=multiplication_15, B=B_8)

bounds_9 = Bounds(Numbers=shift_list_8)
remap_numbers_9 = RemapNumbers(Value=shift_list_8, Source=bounds_9, Target=Domain(-1, 1))  # -> Mapped, Clipped
multiplication_17 = Multiplication(A=length, B=remap_numbers_9.Mapped)
B_9 = ClusterInput()
multiplication_18 = Multiplication(A=multiplication_17, B=B_9)

bounds_10 = Bounds(Numbers=shift_list_7)
remap_numbers_10 = RemapNumbers(Value=shift_list_7, Source=bounds_10, Target=Domain(-1, 1))  # -> Mapped, Clipped
multiplication_19 = Multiplication(A=length, B=remap_numbers_10.Mapped)
B_10 = ClusterInput()
multiplication_20 = Multiplication(A=multiplication_19, B=B_10)

bounds_11 = Bounds(Numbers=shift_list_6)
remap_numbers_11 = RemapNumbers(Value=shift_list_6, Source=bounds_11, Target=Domain(-1, 1))  # -> Mapped, Clipped
multiplication_21 = Multiplication(A=length, B=remap_numbers_11.Mapped)
B_11 = ClusterInput()
multiplication_22 = Multiplication(A=multiplication_21, B=B_11)

bounds_12 = Bounds(Numbers=shift_list_5)
remap_numbers_12 = RemapNumbers(Value=shift_list_5, Source=bounds_12, Target=Domain(-1, 1))  # -> Mapped, Clipped
multiplication_23 = Multiplication(A=length, B=remap_numbers_12.Mapped)
B_12 = ClusterInput()
multiplication_24 = Multiplication(A=multiplication_23, B=B_12)

bounds_13 = Bounds(Numbers=shift_list_4)
remap_numbers_13 = RemapNumbers(Value=shift_list_4, Source=bounds_13, Target=Domain(-1, 1))  # -> Mapped, Clipped
multiplication_25 = Multiplication(A=length, B=remap_numbers_13.Mapped)
B_13 = ClusterInput()
multiplication_26 = Multiplication(A=multiplication_25, B=B_13)

bounds_14 = Bounds(Numbers=shift_list_3)
remap_numbers_14 = RemapNumbers(Value=shift_list_3, Source=bounds_14, Target=Domain(-1, 1))  # -> Mapped, Clipped
multiplication_27 = Multiplication(A=length, B=remap_numbers_14.Mapped)
B_14 = ClusterInput()
multiplication_28 = Multiplication(A=multiplication_27, B=B_14)

bounds_15 = Bounds(Numbers=shift_list_2)
remap_numbers_15 = RemapNumbers(Value=shift_list_2, Source=bounds_15, Target=Domain(-1, 1))  # -> Mapped, Clipped
multiplication_29 = Multiplication(A=length, B=remap_numbers_15.Mapped)
B_15 = ClusterInput()
multiplication_30 = Multiplication(A=multiplication_29, B=B_15)

bounds_16 = Bounds(Numbers=shift_list)
remap_numbers_16 = RemapNumbers(Value=shift_list, Source=bounds_16, Target=Domain(-1, 1))  # -> Mapped, Clipped
multiplication_31 = Multiplication(A=length, B=remap_numbers_16.Mapped)
B_16 = ClusterInput()
multiplication_32 = Multiplication(A=multiplication_31, B=B_16)

create_material_4 = CreateMaterial(Diffuse=RGB(214, 214, 214), Specular=RGB(0, 255, 255), Emission=RGB(0, 0, 0), Transparency=0.5, Shine=100)
create_material_5 = CreateMaterial(Diffuse=RGB(240, 240, 240), Specular=RGB(0, 255, 255), Emission=RGB(0, 0, 0), Transparency=0.5, Shine=100)
quick_graph_2 = QuickGraph(shift_list, SortOrder=0)
line_sdl_2 = LineSDL(Start=evaluate_length_2.Point, Direction=line_2, Length=expr("ABS(X)", multiplication_32))
evaluate_length_3 = EvaluateLength(Curve=line_sdl_2, Length=1, Normalized=True)  # -> Point, Tangent, Parameter
interpolate_2 = Interpolate(Vertices=evaluate_length_3.Point, Degree=1, Periodic=False, KnotStyle=2)  # -> Curve, Length, Domain
custom_preview_4 = CustomPreview(Geometry=interpolate_2.Curve, Material=create_material_4)
custom_preview_5 = CustomPreview(Geometry=line_sdl_2, Material=create_material_5)

explode_2 = Explode(Curve=interpolate_2.Curve, Recursive=True)  # -> Segments, Vertices
evaluate_length_4 = EvaluateLength(Curve=explode_2.Segments, Length=0.5, Normalized=True)  # -> Point, Tangent, Parameter
curve_closest_point_2 = CurveClosestPoint(Point=evaluate_length_4.Point, Curve=curve_2)  # -> Point, Parameter, Distance
line_3 = Line(StartPoint=curve_closest_point_2.Point, EndPoint=evaluate_length_4.Point)

create_material_6 = CreateMaterial(Diffuse=RGB(207, 207, 207), Specular=RGB(0, 255, 255), Emission=RGB(0, 0, 0), Transparency=0.5, Shine=100)
create_material_7 = CreateMaterial(Diffuse=RGB(232, 232, 232), Specular=RGB(0, 255, 255), Emission=RGB(0, 0, 0), Transparency=0.5, Shine=100)
quick_graph_3 = QuickGraph(shift_list_2, SortOrder=0)
line_sdl_3 = LineSDL(Start=evaluate_length_4.Point, Direction=line_3, Length=expr("ABS(X)", multiplication_30))
evaluate_length_5 = EvaluateLength(Curve=line_sdl_3, Length=1, Normalized=True)  # -> Point, Tangent, Parameter
interpolate_3 = Interpolate(Vertices=evaluate_length_5.Point, Degree=1, Periodic=False, KnotStyle=2)  # -> Curve, Length, Domain
custom_preview_6 = CustomPreview(Geometry=interpolate_3.Curve, Material=create_material_6)
custom_preview_7 = CustomPreview(Geometry=line_sdl_3, Material=create_material_7)

explode_3 = Explode(Curve=interpolate_3.Curve, Recursive=True)  # -> Segments, Vertices
evaluate_length_6 = EvaluateLength(Curve=explode_3.Segments, Length=0.5, Normalized=True)  # -> Point, Tangent, Parameter
curve_closest_point_3 = CurveClosestPoint(Point=evaluate_length_6.Point, Curve=curve_2)  # -> Point, Parameter, Distance
line_4 = Line(StartPoint=curve_closest_point_3.Point, EndPoint=evaluate_length_6.Point)

create_material_8 = CreateMaterial(Diffuse=RGB(199, 199, 199), Specular=RGB(0, 255, 255), Emission=RGB(0, 0, 0), Transparency=0.5, Shine=100)
create_material_9 = CreateMaterial(Diffuse=RGB(224, 224, 224), Specular=RGB(0, 255, 255), Emission=RGB(0, 0, 0), Transparency=0.5, Shine=100)
quick_graph_4 = QuickGraph(shift_list_3, SortOrder=0)
line_sdl_4 = LineSDL(Start=evaluate_length_6.Point, Direction=line_4, Length=expr("ABS(X)", multiplication_28))
evaluate_length_7 = EvaluateLength(Curve=line_sdl_4, Length=1, Normalized=True)  # -> Point, Tangent, Parameter
interpolate_4 = Interpolate(Vertices=evaluate_length_7.Point, Degree=1, Periodic=False, KnotStyle=2)  # -> Curve, Length, Domain
custom_preview_8 = CustomPreview(Geometry=interpolate_4.Curve, Material=create_material_8)
custom_preview_9 = CustomPreview(Geometry=line_sdl_4, Material=create_material_9)

explode_4 = Explode(Curve=interpolate_4.Curve, Recursive=True)  # -> Segments, Vertices
evaluate_length_8 = EvaluateLength(Curve=explode_4.Segments, Length=0.5, Normalized=True)  # -> Point, Tangent, Parameter
curve_closest_point_4 = CurveClosestPoint(Point=evaluate_length_8.Point, Curve=curve_2)  # -> Point, Parameter, Distance
line_5 = Line(StartPoint=curve_closest_point_4.Point, EndPoint=evaluate_length_8.Point)

create_material_10 = CreateMaterial(Diffuse=RGB(191, 191, 191), Specular=RGB(0, 255, 255), Emission=RGB(0, 0, 0), Transparency=0.5, Shine=100)
create_material_11 = CreateMaterial(Diffuse=RGB(217, 217, 217), Specular=RGB(0, 255, 255), Emission=RGB(0, 0, 0), Transparency=0.5, Shine=100)
quick_graph_5 = QuickGraph(shift_list_4, SortOrder=0)
line_sdl_5 = LineSDL(Start=evaluate_length_8.Point, Direction=line_5, Length=expr("ABS(X)", multiplication_26))
evaluate_length_9 = EvaluateLength(Curve=line_sdl_5, Length=1, Normalized=True)  # -> Point, Tangent, Parameter
interpolate_5 = Interpolate(Vertices=evaluate_length_9.Point, Degree=1, Periodic=False, KnotStyle=2)  # -> Curve, Length, Domain
custom_preview_10 = CustomPreview(Geometry=interpolate_5.Curve, Material=create_material_10)
custom_preview_11 = CustomPreview(Geometry=line_sdl_5, Material=create_material_11)

explode_5 = Explode(Curve=interpolate_5.Curve, Recursive=True)  # -> Segments, Vertices
evaluate_length_10 = EvaluateLength(Curve=explode_5.Segments, Length=0.5, Normalized=True)  # -> Point, Tangent, Parameter
curve_closest_point_5 = CurveClosestPoint(Point=evaluate_length_10.Point, Curve=curve_2)  # -> Point, Parameter, Distance
line_6 = Line(StartPoint=curve_closest_point_5.Point, EndPoint=evaluate_length_10.Point)

create_material_12 = CreateMaterial(Diffuse=RGB(184, 184, 184), Specular=RGB(0, 255, 255), Emission=RGB(0, 0, 0), Transparency=0.5, Shine=100)
create_material_13 = CreateMaterial(Diffuse=RGB(209, 209, 209), Specular=RGB(0, 255, 255), Emission=RGB(0, 0, 0), Transparency=0.5, Shine=100)
quick_graph_6 = QuickGraph(shift_list_5, SortOrder=0)
line_sdl_6 = LineSDL(Start=evaluate_length_10.Point, Direction=line_6, Length=expr("ABS(X)", multiplication_24))
evaluate_length_11 = EvaluateLength(Curve=line_sdl_6, Length=1, Normalized=True)  # -> Point, Tangent, Parameter
interpolate_6 = Interpolate(Vertices=evaluate_length_11.Point, Degree=1, Periodic=False, KnotStyle=2)  # -> Curve, Length, Domain
custom_preview_12 = CustomPreview(Geometry=interpolate_6.Curve, Material=create_material_12)
custom_preview_13 = CustomPreview(Geometry=line_sdl_6, Material=create_material_13)

explode_6 = Explode(Curve=interpolate_6.Curve, Recursive=True)  # -> Segments, Vertices
evaluate_length_12 = EvaluateLength(Curve=explode_6.Segments, Length=0.5, Normalized=True)  # -> Point, Tangent, Parameter
curve_closest_point_6 = CurveClosestPoint(Point=evaluate_length_12.Point, Curve=curve_2)  # -> Point, Parameter, Distance
line_7 = Line(StartPoint=curve_closest_point_6.Point, EndPoint=evaluate_length_12.Point)

create_material_14 = CreateMaterial(Diffuse=RGB(176, 176, 176), Specular=RGB(0, 255, 255), Emission=RGB(0, 0, 0), Transparency=0.5, Shine=100)
create_material_15 = CreateMaterial(Diffuse=RGB(201, 201, 201), Specular=RGB(0, 255, 255), Emission=RGB(0, 0, 0), Transparency=0.5, Shine=100)
quick_graph_7 = QuickGraph(shift_list_6, SortOrder=0)
line_sdl_7 = LineSDL(Start=evaluate_length_12.Point, Direction=line_7, Length=expr("ABS(X)", multiplication_22))
evaluate_length_13 = EvaluateLength(Curve=line_sdl_7, Length=1, Normalized=True)  # -> Point, Tangent, Parameter
interpolate_7 = Interpolate(Vertices=evaluate_length_13.Point, Degree=1, Periodic=False, KnotStyle=2)  # -> Curve, Length, Domain
custom_preview_14 = CustomPreview(Geometry=interpolate_7.Curve, Material=create_material_14)
custom_preview_15 = CustomPreview(Geometry=line_sdl_7, Material=create_material_15)

explode_7 = Explode(Curve=interpolate_7.Curve, Recursive=True)  # -> Segments, Vertices
evaluate_length_14 = EvaluateLength(Curve=explode_7.Segments, Length=0.5, Normalized=True)  # -> Point, Tangent, Parameter
curve_closest_point_7 = CurveClosestPoint(Point=evaluate_length_14.Point, Curve=curve_2)  # -> Point, Parameter, Distance
line_8 = Line(StartPoint=curve_closest_point_7.Point, EndPoint=evaluate_length_14.Point)

create_material_16 = CreateMaterial(Diffuse=RGB(168, 168, 168), Specular=RGB(0, 255, 255), Emission=RGB(0, 0, 0), Transparency=0.5, Shine=100)
create_material_17 = CreateMaterial(Diffuse=RGB(194, 194, 194), Specular=RGB(0, 255, 255), Emission=RGB(0, 0, 0), Transparency=0.5, Shine=100)
quick_graph_8 = QuickGraph(shift_list_7, SortOrder=0)
line_sdl_8 = LineSDL(Start=evaluate_length_14.Point, Direction=line_8, Length=expr("ABS(X)", multiplication_20))
evaluate_length_15 = EvaluateLength(Curve=line_sdl_8, Length=1, Normalized=True)  # -> Point, Tangent, Parameter
interpolate_8 = Interpolate(Vertices=evaluate_length_15.Point, Degree=1, Periodic=False, KnotStyle=2)  # -> Curve, Length, Domain
custom_preview_16 = CustomPreview(Geometry=interpolate_8.Curve, Material=create_material_16)
custom_preview_17 = CustomPreview(Geometry=line_sdl_8, Material=create_material_17)

explode_8 = Explode(Curve=interpolate_8.Curve, Recursive=True)  # -> Segments, Vertices
evaluate_length_16 = EvaluateLength(Curve=explode_8.Segments, Length=0.5, Normalized=True)  # -> Point, Tangent, Parameter
curve_closest_point_8 = CurveClosestPoint(Point=evaluate_length_16.Point, Curve=curve_2)  # -> Point, Parameter, Distance
line_9 = Line(StartPoint=curve_closest_point_8.Point, EndPoint=evaluate_length_16.Point)

create_material_18 = CreateMaterial(Diffuse=RGB(161, 161, 161), Specular=RGB(0, 255, 255), Emission=RGB(0, 0, 0), Transparency=0.5, Shine=100)
create_material_19 = CreateMaterial(Diffuse=RGB(186, 186, 186), Specular=RGB(0, 255, 255), Emission=RGB(0, 0, 0), Transparency=0.5, Shine=100)
quick_graph_9 = QuickGraph(shift_list_8, SortOrder=0)
line_sdl_9 = LineSDL(Start=evaluate_length_16.Point, Direction=line_9, Length=expr("ABS(X)", multiplication_18))
evaluate_length_17 = EvaluateLength(Curve=line_sdl_9, Length=1, Normalized=True)  # -> Point, Tangent, Parameter
interpolate_9 = Interpolate(Vertices=evaluate_length_17.Point, Degree=1, Periodic=False, KnotStyle=2)  # -> Curve, Length, Domain
custom_preview_18 = CustomPreview(Geometry=interpolate_9.Curve, Material=create_material_18)
custom_preview_19 = CustomPreview(Geometry=line_sdl_9, Material=create_material_19)

explode_9 = Explode(Curve=interpolate_9.Curve, Recursive=True)  # -> Segments, Vertices
evaluate_length_18 = EvaluateLength(Curve=explode_9.Segments, Length=0.5, Normalized=True)  # -> Point, Tangent, Parameter
curve_closest_point_9 = CurveClosestPoint(Point=evaluate_length_18.Point, Curve=curve_2)  # -> Point, Parameter, Distance
line_10 = Line(StartPoint=curve_closest_point_9.Point, EndPoint=evaluate_length_18.Point)

create_material_20 = CreateMaterial(Diffuse=RGB(153, 153, 153), Specular=RGB(0, 255, 255), Emission=RGB(0, 0, 0), Transparency=0.5, Shine=100)
create_material_21 = CreateMaterial(Diffuse=RGB(178, 178, 178), Specular=RGB(0, 255, 255), Emission=RGB(0, 0, 0), Transparency=0.5, Shine=100)
quick_graph_10 = QuickGraph(shift_list_9, SortOrder=0)
line_sdl_10 = LineSDL(Start=evaluate_length_18.Point, Direction=line_10, Length=expr("ABS(X)", multiplication_16))
evaluate_length_19 = EvaluateLength(Curve=line_sdl_10, Length=1, Normalized=True)  # -> Point, Tangent, Parameter
interpolate_10 = Interpolate(Vertices=evaluate_length_19.Point, Degree=1, Periodic=False, KnotStyle=2)  # -> Curve, Length, Domain
custom_preview_20 = CustomPreview(Geometry=interpolate_10.Curve, Material=create_material_20)
custom_preview_21 = CustomPreview(Geometry=line_sdl_10, Material=create_material_21)

explode_10 = Explode(Curve=interpolate_10.Curve, Recursive=True)  # -> Segments, Vertices
evaluate_length_20 = EvaluateLength(Curve=explode_10.Segments, Length=0.5, Normalized=True)  # -> Point, Tangent, Parameter
curve_closest_point_10 = CurveClosestPoint(Point=evaluate_length_20.Point, Curve=curve_2)  # -> Point, Parameter, Distance
line_11 = Line(StartPoint=curve_closest_point_10.Point, EndPoint=evaluate_length_20.Point)

create_material_22 = CreateMaterial(Diffuse=RGB(145, 145, 145), Specular=RGB(0, 255, 255), Emission=RGB(0, 0, 0), Transparency=0.5, Shine=100)
create_material_23 = CreateMaterial(Diffuse=RGB(171, 171, 171), Specular=RGB(0, 255, 255), Emission=RGB(0, 0, 0), Transparency=0.5, Shine=100)
quick_graph_11 = QuickGraph(shift_list_10, SortOrder=0)
line_sdl_11 = LineSDL(Start=evaluate_length_20.Point, Direction=line_11, Length=expr("ABS(X)", multiplication_14))
evaluate_length_21 = EvaluateLength(Curve=line_sdl_11, Length=1, Normalized=True)  # -> Point, Tangent, Parameter
interpolate_11 = Interpolate(Vertices=evaluate_length_21.Point, Degree=1, Periodic=False, KnotStyle=2)  # -> Curve, Length, Domain
custom_preview_22 = CustomPreview(Geometry=interpolate_11.Curve, Material=create_material_22)
custom_preview_23 = CustomPreview(Geometry=line_sdl_11, Material=create_material_23)

explode_11 = Explode(Curve=interpolate_11.Curve, Recursive=True)  # -> Segments, Vertices
evaluate_length_22 = EvaluateLength(Curve=explode_11.Segments, Length=0.5, Normalized=True)  # -> Point, Tangent, Parameter
curve_closest_point_11 = CurveClosestPoint(Point=evaluate_length_22.Point, Curve=curve_2)  # -> Point, Parameter, Distance
line_12 = Line(StartPoint=curve_closest_point_11.Point, EndPoint=evaluate_length_22.Point)

create_material_24 = CreateMaterial(Diffuse=RGB(138, 138, 138), Specular=RGB(0, 255, 255), Emission=RGB(0, 0, 0), Transparency=0.5, Shine=100)
create_material_25 = CreateMaterial(Diffuse=RGB(163, 163, 163), Specular=RGB(0, 255, 255), Emission=RGB(0, 0, 0), Transparency=0.5, Shine=100)
quick_graph_12 = QuickGraph(shift_list_11, SortOrder=0)
line_sdl_12 = LineSDL(Start=evaluate_length_22.Point, Direction=line_12, Length=expr("ABS(X)", multiplication_12))
evaluate_length_23 = EvaluateLength(Curve=line_sdl_12, Length=1, Normalized=True)  # -> Point, Tangent, Parameter
interpolate_12 = Interpolate(Vertices=evaluate_length_23.Point, Degree=1, Periodic=False, KnotStyle=2)  # -> Curve, Length, Domain
custom_preview_24 = CustomPreview(Geometry=interpolate_12.Curve, Material=create_material_24)
custom_preview_25 = CustomPreview(Geometry=line_sdl_12, Material=create_material_25)

explode_12 = Explode(Curve=interpolate_12.Curve, Recursive=True)  # -> Segments, Vertices
evaluate_length_24 = EvaluateLength(Curve=explode_12.Segments, Length=0.5, Normalized=True)  # -> Point, Tangent, Parameter
curve_closest_point_12 = CurveClosestPoint(Point=evaluate_length_24.Point, Curve=curve_2)  # -> Point, Parameter, Distance
line_13 = Line(StartPoint=curve_closest_point_12.Point, EndPoint=evaluate_length_24.Point)

create_material_26 = CreateMaterial(Diffuse=RGB(130, 130, 130), Specular=RGB(0, 255, 255), Emission=RGB(0, 0, 0), Transparency=0.5, Shine=100)
create_material_27 = CreateMaterial(Diffuse=RGB(156, 156, 156), Specular=RGB(0, 255, 255), Emission=RGB(0, 0, 0), Transparency=0.5, Shine=100)
quick_graph_13 = QuickGraph(shift_list_12, SortOrder=0)
line_sdl_13 = LineSDL(Start=evaluate_length_24.Point, Direction=line_13, Length=expr("ABS(X)", multiplication_10))
evaluate_length_25 = EvaluateLength(Curve=line_sdl_13, Length=1, Normalized=True)  # -> Point, Tangent, Parameter
interpolate_13 = Interpolate(Vertices=evaluate_length_25.Point, Degree=1, Periodic=False, KnotStyle=2)  # -> Curve, Length, Domain
custom_preview_26 = CustomPreview(Geometry=interpolate_13.Curve, Material=create_material_26)
custom_preview_27 = CustomPreview(Geometry=line_sdl_13, Material=create_material_27)

explode_13 = Explode(Curve=interpolate_13.Curve, Recursive=True)  # -> Segments, Vertices
evaluate_length_26 = EvaluateLength(Curve=explode_13.Segments, Length=0.5, Normalized=True)  # -> Point, Tangent, Parameter
curve_closest_point_13 = CurveClosestPoint(Point=evaluate_length_26.Point, Curve=curve_2)  # -> Point, Parameter, Distance
line_14 = Line(StartPoint=curve_closest_point_13.Point, EndPoint=evaluate_length_26.Point)

create_material_28 = CreateMaterial(Diffuse=RGB(122, 122, 122), Specular=RGB(0, 255, 255), Emission=RGB(0, 0, 0), Transparency=0.5, Shine=100)
create_material_29 = CreateMaterial(Diffuse=RGB(148, 148, 148), Specular=RGB(0, 255, 255), Emission=RGB(0, 0, 0), Transparency=0.5, Shine=100)
quick_graph_14 = QuickGraph(shift_list_13, SortOrder=0)
line_sdl_14 = LineSDL(Start=evaluate_length_26.Point, Direction=line_14, Length=expr("ABS(X)", multiplication_8))
evaluate_length_27 = EvaluateLength(Curve=line_sdl_14, Length=1, Normalized=True)  # -> Point, Tangent, Parameter
interpolate_14 = Interpolate(Vertices=evaluate_length_27.Point, Degree=1, Periodic=False, KnotStyle=2)  # -> Curve, Length, Domain
custom_preview_28 = CustomPreview(Geometry=interpolate_14.Curve, Material=create_material_28)
custom_preview_29 = CustomPreview(Geometry=line_sdl_14, Material=create_material_29)

explode_14 = Explode(Curve=interpolate_14.Curve, Recursive=True)  # -> Segments, Vertices
evaluate_length_28 = EvaluateLength(Curve=explode_14.Segments, Length=0.5, Normalized=True)  # -> Point, Tangent, Parameter
curve_closest_point_14 = CurveClosestPoint(Point=evaluate_length_28.Point, Curve=curve_2)  # -> Point, Parameter, Distance
line_15 = Line(StartPoint=curve_closest_point_14.Point, EndPoint=evaluate_length_28.Point)

create_material_30 = CreateMaterial(Diffuse=RGB(115, 115, 115), Specular=RGB(0, 255, 255), Emission=RGB(0, 0, 0), Transparency=0.5, Shine=100)
create_material_31 = CreateMaterial(Diffuse=RGB(140, 140, 140), Specular=RGB(0, 255, 255), Emission=RGB(0, 0, 0), Transparency=0.5, Shine=100)
quick_graph_15 = QuickGraph(shift_list_14, SortOrder=0)
line_sdl_15 = LineSDL(Start=evaluate_length_28.Point, Direction=line_15, Length=expr("ABS(X)", multiplication_6))
evaluate_length_29 = EvaluateLength(Curve=line_sdl_15, Length=1, Normalized=True)  # -> Point, Tangent, Parameter
interpolate_15 = Interpolate(Vertices=evaluate_length_29.Point, Degree=1, Periodic=False, KnotStyle=2)  # -> Curve, Length, Domain
custom_preview_30 = CustomPreview(Geometry=interpolate_15.Curve, Material=create_material_30)
custom_preview_31 = CustomPreview(Geometry=line_sdl_15, Material=create_material_31)

explode_15 = Explode(Curve=interpolate_15.Curve, Recursive=True)  # -> Segments, Vertices
evaluate_length_30 = EvaluateLength(Curve=explode_15.Segments, Length=0.5, Normalized=True)  # -> Point, Tangent, Parameter
curve_closest_point_15 = CurveClosestPoint(Point=evaluate_length_30.Point, Curve=curve_2)  # -> Point, Parameter, Distance
line_16 = Line(StartPoint=curve_closest_point_15.Point, EndPoint=evaluate_length_30.Point)

bounds_17 = Bounds(Numbers=shift_list_15)
remap_numbers_17 = RemapNumbers(Value=shift_list_15, Source=bounds_17, Target=Domain(-1, 1))  # -> Mapped, Clipped
multiplication_33 = Multiplication(A=length, B=remap_numbers_17.Mapped)
B_17 = ClusterInput()
multiplication_34 = Multiplication(A=multiplication_33, B=B_17)

create_material_32 = CreateMaterial(Diffuse=RGB(107, 107, 107), Specular=RGB(0, 255, 255), Emission=RGB(0, 0, 0), Transparency=0.5, Shine=100)
create_material_33 = CreateMaterial(Diffuse=RGB(133, 133, 133), Specular=RGB(0, 255, 255), Emission=RGB(0, 0, 0), Transparency=0.5, Shine=100)
quick_graph_16 = QuickGraph(shift_list_15, SortOrder=0)
line_sdl_16 = LineSDL(Start=evaluate_length_30.Point, Direction=line_16, Length=expr("ABS(X)", multiplication_34))
evaluate_length_31 = EvaluateLength(Curve=line_sdl_16, Length=1, Normalized=True)  # -> Point, Tangent, Parameter
interpolate_16 = Interpolate(Vertices=evaluate_length_31.Point, Degree=1, Periodic=False, KnotStyle=2)  # -> Curve, Length, Domain
custom_preview_32 = CustomPreview(Geometry=interpolate_16.Curve, Material=create_material_32)
custom_preview_33 = CustomPreview(Geometry=line_sdl_16, Material=create_material_33)

explode_16 = Explode(Curve=interpolate_16.Curve, Recursive=True)  # -> Segments, Vertices
evaluate_length_32 = EvaluateLength(Curve=explode_16.Segments, Length=0.5, Normalized=True)  # -> Point, Tangent, Parameter
curve_closest_point_16 = CurveClosestPoint(Point=evaluate_length_32.Point, Curve=curve_2)  # -> Point, Parameter, Distance
line_17 = Line(StartPoint=curve_closest_point_16.Point, EndPoint=evaluate_length_32.Point)

create_material_34 = CreateMaterial(Diffuse=RGB(99, 99, 99), Specular=RGB(0, 255, 255), Emission=RGB(0, 0, 0), Transparency=0.5, Shine=100)
create_material_35 = CreateMaterial(Diffuse=RGB(125, 125, 125), Specular=RGB(0, 255, 255), Emission=RGB(0, 0, 0), Transparency=0.5, Shine=100)
quick_graph_17 = QuickGraph(shift_list_16, SortOrder=0)
line_sdl_17 = LineSDL(Start=evaluate_length_32.Point, Direction=line_17, Length=expr("ABS(X)", multiplication_4))
evaluate_length_33 = EvaluateLength(Curve=line_sdl_17, Length=1, Normalized=True)  # -> Point, Tangent, Parameter
interpolate_17 = Interpolate(Vertices=evaluate_length_33.Point, Degree=1, Periodic=False, KnotStyle=2)  # -> Curve, Length, Domain
custom_preview_34 = CustomPreview(Geometry=interpolate_17.Curve, Material=create_material_34)
custom_preview_35 = CustomPreview(Geometry=line_sdl_17, Material=create_material_35)
