# Grasshopper definition XHG.⠀⠀⠀⠀ⵙ⠀ᗱᗴ⠀ⵙ⠀ᴥ⠀ⵙ⠀ᗱᗴ⠀ⵙ⠀옷⠀ⵙ⠀ߦ⠀ⵙ⠀ᔓᔕ⠀ⵙ⠀◯⠀ⵙ⠀✤⠀ⵙ⠀ᴥ⠀ⵙ⠀ᗩ⠀ⵙ⠀옷⠀ⵙ⠀ᑐᑕ⠀ⵙ⠀◯⠀ⵙ⠀⁂⠀ⵙ⠀△⠀ⵙ⠀ⵈ⠀ⵙ⠀⠀⠀⠀◯⠀⠀⠀⠀ⵙ⠀⠀⠀⠀◯⠀⠀⠀⠀ⵙ⠀ⵈ⠀ⵙ⠀△⠀ⵙ⠀⁂⠀ⵙ⠀◯⠀ⵙ⠀ᑐᑕ⠀ⵙ⠀옷⠀ⵙ⠀ᗩ⠀ⵙ⠀ᴥ⠀ⵙ⠀✤⠀ⵙ⠀◯⠀ⵙ⠀ᔓᔕ⠀ⵙ⠀ߦ⠀ⵙ⠀옷⠀ⵙ⠀ᗱᗴ⠀ⵙ⠀ᴥ⠀ⵙ⠀ᗱᗴ⠀ⵙ⠀⠀⠀⠀.GHX (Grasshopper 1.0.7)
# plug-ins: Firefly.X, CurvePlus, TT Toolbox, Pancake, Wombat, Kangaroo2 Components, Pufferfish, NGon, Yellow, MeshEdit Components

panel = Panel("84.406022589954030768899117092091000289089388918088900852079")
evaluate = Evaluate(Expression="Format(\"{0:0.00000000}\", X)", X=panel)
number = Number(panel)
panel_2 = Panel("14")
panel_3 = Panel(evaluate)
panel_4 = Panel("84.406022589954030768899117092091000289089388918088900852079")
one_over_x = OneOverX(Value=Slider(25, range=1..65))
panel_5 = Panel(number)
series = Series(Start=0, Step=1, Count=379)
expression = Expression(O=series, Expression="((3^(1/3^3))^O)/84.406022589954030768899117092091000289089388918088900852079")
series_2 = Series(Start="0", Step="1", Count=Slider(351, range=1..1025))
power = Power(A=3, B=one_over_x)
power_2 = Power(A=power, B=series_2)
panel_6 = Panel(expression)
division = Division(A=panel_4, B=power_2)
multiplication = Multiplication(A=division, B="299792458")
graft_tree = GraftTree(Tree=multiplication, IncludeEmptyLists=True, IncludeNullItems=True)
graft_tree_2 = GraftTree(Tree=division, IncludeEmptyLists=True, IncludeNullItems=True)
division_2 = Division(A=power_2, B=panel_4)
graft_tree_3 = GraftTree(Tree=division_2, IncludeEmptyLists=True, IncludeNullItems=True)
evaluate_2 = Evaluate(Expression="Format(\"{0:0.0000000000000000}\", X)", X=expression)
panel_7 = Panel(evaluate_2)
power_3 = Power(A="9", B="0")
division_3 = Division(A=panel_4, B=power_3)
one_over_x_2 = OneOverX(Value=power_3)
construct_point = ConstructPoint(XCoordinate=0, YCoordinate=graft_tree_2, ZCoordinate=0)
panel_8 = Panel("""28160.0000000000000000 
26579.5006451166000000 
25087.7079028320000000 
23679.6430535447000000 
22350.6068117123000000 
21096.1636424237000000 
19912.1269582132000000 
18794.5451467141000000 
17739.6883825199000000 
16744.0361792384000000 
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""")
panel_9 = Panel([graft_tree_2, graft_tree_3, graft_tree])
panel_10 = Panel("""-0.0009967000000000 
-3.6736000000000000 
-0.0009967000000000 
-0.0009967000000000 
-0.0009967000000000 
-5.7216000000000000 
-0.0009967000000000 
-7.6629330000000000 
-11.1104000000000000 
-13.5850670000000000 
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""")
text_split = TextSplit(Text=panel_8, Separators=" ")
panel_11 = Panel(text_split)
numbers_to_points = NumbersToPoints(Numbers=panel_9, Mask=4)
digit_scroller = DigitScroller(Scroller_Digits=12, Scroller_Prefix="Digit Scroller", Scroller_Radix=11, Scroller_Value=378)
expression_2 = Expression(O=digit_scroller, Expression="((3^(1/3^3))^O)/84.406022589954030768899117092091000289089388918088900852079")
line = Line(StartPoint=Point(0, 0, 0), EndPoint=construct_point)
spiral_rail = SpiralRail(Curve=line, Angle=0, Turns=1, BaseRadius=construct_point, PeakRadius=construct_point, SamplePoint=256)
text_split_2 = TextSplit(Text=panel_10, Separators=" ")
panel_12 = Panel(text_split_2)
xz_plane = XZPlane(Origin=Point(0, 0, 0))
rotate = Rotate(Geometry=spiral_rail, Angle=1.570796327, Plane=xz_plane)  # -> Geometry, Transform
text_tag = TextTag(Location=construct_point, Text=numbers_to_points, Colour=RGB(212, 212, 212))
tone_generator = ToneGenerator(AudioFrequency=expression_2, Volume=one_over_x_2, Duration=division_3, Repeat=Toggle(True))
panel_13 = Panel(expression_2)
number_2 = Number(panel_12)
division_4 = Division(A=number_2, B=20)
power_4 = Power(A=10, B=division_4)
panel_14 = Panel(power_4)

xy_plane = XYPlane(Origin=Point(0, 0, 0))
yz_plane = YZPlane(Origin=Point(0, 0, 0))
xz_plane_2 = XZPlane(Origin=Point(0, 0, 0))
yz_plane_2 = YZPlane(Origin=Point(0, 0, 0))
number_slider = Slider(0, range=0..90)
rotate_direction = RotateDirection(Geometry=xz_plane_2, Center=Point(0, 0, 0), From=Vector(0, 100000, -100000), To=Vector(0, 0, -84641.0625))  # -> Geometry, Transform
rotate_direction_2 = RotateDirection(Geometry=yz_plane_2, Center=Point(0, 0, 0), From=Vector(75498.375, 0, 0), To=Vector(100000, 0, -100000))  # -> Geometry, Transform
plane_surface = PlaneSurface(Plane=xy_plane, XSize=Domain(-100000, 100000), YSize=Domain(-100000, 100000))
plane_surface_2 = PlaneSurface(
    Plane=[xz_plane_2, rotate_direction.Geometry, yz_plane_2, rotate_direction_2.Geometry],
    XSize=Domain(-100000, 100000),
    YSize=Domain(-100000, 100000))
sphere = Sphere(Base=yz_plane_2, Radius=50000)
reverse = Reverse(Vector=xy_plane)
plane_surface_3 = PlaneSurface(Plane=rotate_direction.Geometry, XSize=Domain(-100000, 100000), YSize=Domain(-100000, 100000))
plane_surface_4 = PlaneSurface(Plane=rotate_direction_2.Geometry, XSize=Domain(-100000, 100000), YSize=Domain(-100000, 100000))
surface_split = SurfaceSplit(Surface=sphere, Curves=plane_surface_2)
rotate_2 = Rotate(Geometry=plane_surface, Angle=1.570796327, Plane=yz_plane)  # -> Geometry, Transform
number_slider_2 = Slider(11, range=2..381)
radians = Radians(Degrees=-45)
construct_domain = ConstructDomain(DomainStart=0, DomainEnd=radians)
rotate_3 = Rotate(Geometry=rotate_2.Geometry, Angle=-1.570796327, Plane=PlaneXY(0, 0, 0))  # -> Geometry, Transform
brep_brep = BrepBrep(BrepA=plane_surface_3, BrepB=plane_surface_4, UseTasks=False)  # -> Curves, Points
list_item = ListItem(List=surface_split, Index=Slider(13, range=0..16), Wrap=False)
number_slider_3 = Slider(27, range=0..512)
reparameterize_curve = ReparameterizeCurve()  # -> Reparameterized, Original
brep_edges = BrepEdges(Brep=list_item)  # -> Naked, Interior, NonManifold
end_points = EndPoints(Curve=brep_edges.Naked)  # -> Start, End
data = Data([end_points.Start, end_points.End])
point = Point(Point(0, 0, 0))
list_item_2 = ListItem(List=data, Index=2, Wrap=False)
list_item_3 = ListItem(List=data, Index=3, Wrap=False)
list_item_4 = ListItem(List=data, Index=0, Wrap=False)
list_item_5 = ListItem(List=data, Index=4, Wrap=False)

length = Length(Curve=brep_edges.Naked)
list_item_6 = ListItem(List=length, Index=Slider(1, range=0..1), Wrap=False)
panel_15 = Panel(list_item_6)

point_2 = Point(flatten([point, list_item_3, list_item_5]))
point_3 = Point(flatten([list_item_4, point, list_item_2]))
_4point_surface = _4PointSurface(CornerA=point, CornerB=list_item_3, CornerC=list_item_5)
_4point_surface_2 = _4PointSurface(CornerA=point, CornerB=list_item_4, CornerC=list_item_2)
scale = Scale(Geometry=[_4point_surface_2, _4point_surface], Center=Point(0, 0, 0), Factor=2)  # -> Geometry, Transform
brep_brep_2 = BrepBrep(BrepA=_4point_surface_2, BrepB=_4point_surface)  # -> Curves, Points
brep_plane = BrepPlane(Brep=list_item, Plane=scale.Geometry)  # -> graft(Curves), graft(Points)
brep_edges_2 = BrepEdges(Brep=list_item)  # -> Naked, Interior, NonManifold
join_curves = JoinCurves(Curves=flatten(brep_edges_2.Naked), Preserve=False)  # -> flatten(Curves)
number_slider_4 = Slider(0, range=0..90)
range = Range(Domain=Domain(0, 1), Steps=Slider(8, range=1..10))
range_2 = Range(Domain=Domain(0, 1), Steps=Slider(1, range=1..11))
number_3 = Number(263.7690326)
square_root = SquareRoot(Value=2)
B = B(1.5)
B_2 = B(1.5)

data_2 = Data(0)

range_3 = Range(Domain=Domain(0, 1), Steps=Slider(8, range=1..10))
range_4 = Range(Domain=Domain(0, 1), Steps=Slider(4, range=1..11))

file_path = FilePath("C:\ƧLX...⠀⠀⠀⠀ⵙ✤ᴥᗩ옷ᑐᑕⵙᗝᙁⓄ옷ᔓᔕᗱᗴᴥ옷✤ⵙ人✤ꖴᙁᗩꖴИNᗱᗴᕤᕦИNⓄᑐᑕⵙ人ᑐᑕИNᗱᗴᑎ¤ᗱᗴᴥꗳⵙ⠀⠀⠀⠀◯⠀⠀⠀⠀ⵙ⠀⠀⠀⠀◯⠀⠀⠀⠀ⵙꗳᴥᗱᗴ¤ᑎᗱᗴИNᑐᑕ人ⵙᑐᑕⓄИNᕤᕦᗱᗴИNꖴᗩᙁꖴ✤人ⵙ✤옷ᴥᗱᗴᔓᔕ옷Ⓞᙁᗝⵙᑐᑕ옷ᗩᴥ✤ⵙ⠀⠀⠀⠀...XLS")
worksheet_name = WorksheetName("ⵙⓄᴥߦⵙⵔⵔⵘⵈⵙ옷ᴥⵙ◯ⵙ◯ⵙᴥ옷ⵙⵈⵘⵔⵔⵙߦᴥⓄⵙ")
worksheet_name_2 = WorksheetName("ⵙⓄᴥߦⵙⵔⵔⵘⵈⵙ옷ᴥⵙ◯ⵙ◯ⵙᴥ옷ⵙⵈⵘⵔⵔⵙߦᴥⓄⵙ")
number_slider_5 = Slider(1, range=0..1)
file_path_2 = FilePath("C:\ƧLX...⠀⠀⠀⠀ⵙ✤ᴥᗩ옷ᑐᑕⵙᗝᙁⓄ옷ᔓᔕᗱᗴᴥ옷✤ⵙ人✤ꖴᙁᗩꖴИNᗱᗴᕤᕦИNⓄᑐᑕⵙ人ᑐᑕИNᗱᗴᑎ¤ᗱᗴᴥꗳⵙ⠀⠀⠀⠀◯⠀⠀⠀⠀ⵙ⠀⠀⠀⠀◯⠀⠀⠀⠀ⵙꗳᴥᗱᗴ¤ᑎᗱᗴИNᑐᑕ人ⵙᑐᑕⓄИNᕤᕦᗱᗴИNꖴᗩᙁꖴ✤人ⵙ✤옷ᴥᗱᗴᔓᔕ옷Ⓞᙁᗝⵙᑐᑕ옷ᗩᴥ✤ⵙ⠀⠀⠀⠀...XLS")
read_excel_sheet = ReadExcelSheet(Run=True, FilePath=file_path, Worksheet="1", Listen=True)  # -> UserMessages, Columns, Rows
read_excel_sheet_2 = ReadExcelSheet(Run=True, FilePath=file_path_2, Worksheet="2", Listen=True)  # -> UserMessages, Columns, Rows
panel_16 = Panel("FORMAT(\"{0:0.0000000000000000000}\",O)")
number_slider_6 = Slider(100, range=0..100)
number_slider_7 = Slider(1, range=0..256)
number_slider_8 = Slider(2, range=0..10)
number_slider_9 = Slider(2, range=0..10)
number_4 = Number([2, 4])

data_3 = Data(read_excel_sheet.Columns)
data_4 = Data(read_excel_sheet_2.Columns)

panel_17 = Panel(data_3)
panel_18 = Panel(data_4)
explode_tree = ExplodeTree(Data=panel_17)  # -> Branch0, Branch1, Branch2, Branch3, Branch4, Branch5
explode_tree_2 = ExplodeTree(Data=panel_18)  # -> Branch0, Branch1, Branch2, Branch3, Branch4, Branch5
cull_index = CullIndex(List=explode_tree.Branch4, Indices=[0, 1, 2, 3, 4], Wrap=True)
cull_index_2 = CullIndex(List=explode_tree.Branch2, Indices=[0, 1, 2, 3, 4], Wrap=True)
cull_index_3 = CullIndex(List=explode_tree_2.Branch1, Indices=[0, 1, 2, 3], Wrap=True)
cull_index_4 = CullIndex(List=explode_tree_2.Branch0, Indices=[0, 1, 2, 3], Wrap=True)
panel_19 = Panel(cull_index)
panel_20 = Panel(cull_index_2)
panel_21 = Panel(cull_index_3)
panel_22 = Panel(cull_index_4)
stream_filter = StreamFilter(Gate=number_slider_5, Stream0=panel_19, Stream1=panel_21)
stream_filter_2 = StreamFilter(Gate=number_slider_5, Stream0=panel_20, Stream1=panel_22)
number_5 = Number(stream_filter)
number_6 = Number(stream_filter_2)
evaluate_3 = Evaluate(Expression=panel_16, O=number_5)
panel_23 = Panel(number_6)
evaluate_4 = Evaluate(Expression=panel_16, O=number_6)
number_7 = Number(evaluate_3)
panel_24 = Panel(evaluate_3)
panel_25 = Panel(evaluate_4)
stream_gate = StreamGate(Stream=panel_25, Gate=number_slider_5)  # -> Target0, Target1, Target2
logarithm = Logarithm(Value=stream_gate.Target0)
multiplication_2 = Multiplication(A=logarithm, B=20)
list_length = ListLength(List=panel_24)
panel_26 = Panel(logarithm)
panel_27 = Panel(multiplication_2)
subtraction = Subtraction(A=list_length, B=1)
stream_filter_3 = StreamFilter(Gate=number_slider_5, Stream0=panel_27, Stream1=stream_gate.Target1, Stream2=stream_gate.Target2)
list_item_7 = ListItem(List=panel_24, Index=subtraction, Wrap=True)
list_item_8 = ListItem(List=panel_24, Index=0, Wrap=True)
construct_domain_2 = ConstructDomain(DomainStart=list_item_7, DomainEnd=list_item_8)
range_5 = Range(Domain=construct_domain_2, Steps=subtraction)
list_item_9 = ListItem(List=range_5, Index=0, Wrap=True)
list_item_10 = ListItem(List=range_5, Index=1, Wrap=True)
subtraction_2 = Subtraction(A=list_item_10, B=list_item_9)
division_5 = Division(A=subtraction_2, B=4)
multiplication_3 = Multiplication(A=division_5, B=2)
panel_28 = Panel(range_5)
construct_point_2 = ConstructPoint(XCoordinate=panel_28, YCoordinate=0, ZCoordinate=0)
multiplication_4 = Multiplication(A=stream_filter_3, B=number_3)
panel_29 = Panel(multiplication_4)
sphere_2 = Sphere(Base=construct_point_2, Radius=division_5)
line_sdl = LineSDL(Start=construct_point_2, Direction=Vector(0, 14645.1875, 0), Length=multiplication_4)
pipe = Pipe(Curve=line_sdl, Radius=division_5, Caps=2)
panel_30 = Panel(panel_29)
panel_31 = Panel(line_sdl)
ellipse = Ellipse(Plane=construct_point_2, Radius1=division_5, Radius2=panel_30)  # -> Ellipse, Focus1, Focus2
scale_nu = ScaleNU(Geometry=ellipse.Ellipse, Plane=construct_point_2, ScaleX=1, ScaleY=number_4, ScaleZ=1)  # -> Geometry, Transform
bounding_box = BoundingBox(Content=ellipse.Ellipse, Plane=PlaneXY(0, 0, 0))  # -> Box, Box_2
deconstruct_box = DeconstructBox(Box=bounding_box.Box)  # -> Plane, X, Y, Z
deconstruct_domain = DeconstructDomain(Domain=deconstruct_box.X)  # -> Start, End
subtraction_3 = Subtraction(A=deconstruct_domain.End, B=deconstruct_domain.Start)
panel_32 = Panel(subtraction_3)
deconstruct_domain_2 = DeconstructDomain(Domain=deconstruct_box.Y)  # -> Start, End
vector_xyz = VectorXYZ(XComponent=0, YComponent=deconstruct_domain_2.Start, ZComponent=0)  # -> Vector, Length
move = Move(Geometry=ellipse.Ellipse, Motion=vector_xyz.Vector)  # -> Geometry, Transform
rotate_direction_3 = RotateDirection(Geometry=move.Geometry, Center=construct_point_2, From=Vector(2973.3125, 0, 0), To=Vector(0, 0, -1425.375))  # -> Geometry, Transform
divide_curves_on_intersects = DivideCurvesOnIntersects(Curves=[move.Geometry, rotate_direction_3.Geometry], Tolerance=0)
list_length_2 = ListLength(List=divide_curves_on_intersects)
division_6 = Division(A=list_length_2, B=2)
construct_domain_3 = ConstructDomain(DomainStart=0, DomainEnd=division_6)
subtraction_4 = Subtraction(A=division_6, B=1)
range_6 = Range(Domain=subtraction_4, Steps=subtraction_4)
cull_index_5 = CullIndex(List=divide_curves_on_intersects, Indices=range_6, Wrap=True)
cull_nth = CullNth(List=cull_index_5, CullFrequency=2)
list_item_11 = ListItem(List=cull_nth, Index=Slider(65, range=0..378), Wrap=True)
curve = Curve(cull_nth)
end_points_2 = EndPoints(Curve=curve)  # -> Start, End
panel_33 = Panel(cull_nth)
line_2 = Line(StartPoint=end_points_2.Start, EndPoint=end_points_2.End)
revolution = Revolution(Curve=curve, Axis=line_2, Domain=Domain(0, 6.283185307))
bounding_box_2 = BoundingBox(Content=revolution, Plane=PlaneXY(0, 0, 0), UnionBox=True)  # -> Box, Box_2

negative = Negative(Value=panel_22)
bounds = Bounds(Numbers=panel_22)
subtraction_5 = Subtraction(A=list_length, B=1)
range_7 = Range(Domain=construct_domain, Steps=subtraction_5)
rotate_4 = Rotate(Geometry=rotate_2.Geometry, Angle=range_7, Plane=yz_plane)  # -> Geometry, Transform
brep_plane_2 = BrepPlane(Brep=list_item, Plane=rotate_4.Geometry)  # -> graft(Curves), graft(Points)
negative_2 = Negative(Value=bounds)
remap_numbers = RemapNumbers(Value=negative, Source=negative_2, Target=Domain(0, 1))  # -> flatten(Mapped), Clipped
end_points_3 = EndPoints(Curve=brep_plane_2.Curves)  # -> Start, End
negative_3 = Negative(Value=panel_25)  # -> flatten(Result)
curve_length_at = CurveLengthAt(Curve=brep_plane_2.Curves, Point=remap_numbers.Mapped, Normalized=False)  # -> Length, Parameter
multiplication_5 = Multiplication(A=negative_3, B=number_slider_3)  # -> graft(Result)
multiplication_6 = Multiplication(A=negative_3, B=number_slider_3)  # -> reverse(graft(Result))
negative_4 = Negative(Value=multiplication_6)
scale_to_length = ScaleToLength(
    Curve=brep_plane_2.Curves,
    Plane=[end_points_3.Start, end_points_3.End],
    Length=[multiplication_5, multiplication_6],
    FactorX=1,
    FactorY=1,
    FactorZ=1)  # -> Scaled, Transform
negative_5 = Negative(Value=multiplication_5)

list_length_3 = ListLength(List=panel_28)
subtraction_6 = Subtraction(A=list_length_3, B=1)
list_item_12 = ListItem(List=construct_point_2, Index=subtraction_6, Wrap=False)  # -> flatten(Item)
list_item_13 = ListItem(List=construct_point_2, Index=data_2, Wrap=False)  # -> flatten(Item)
line_3 = Line(StartPoint=list_item_13, EndPoint=list_item_12)
length_2 = Length(Curve=line_3)
panel_34 = Panel(length_2)

division_7 = Division(A=panel_15, B=panel_34)
mirror = Mirror(Geometry=scale_to_length.Scaled, Plane=_4point_surface)  # -> Geometry, Transform
data_5 = Data(flatten([scale_to_length.Scaled, mirror.Geometry]))
multiplication_7 = Multiplication(A=division_5, B=division_7)
offset_on_srf = OffsetOnSrf(Curve=data_5, Distance=1e-10, Surface=list_item)  # -> flatten(Curve)
project = Project(Curve=data_5, Brep=list_item, Direction=brep_brep_2.Curves)
mirror_2 = Mirror(Geometry=offset_on_srf, Plane=yz_plane)  # -> Geometry, Transform
mesh_pipe = MeshPipe(Curve=offset_on_srf, Radius=multiplication_7, Segments=8, Accuracy=1, CapType=3, Faceted=False)  # -> flatten(Mesh)
polar_array = PolarArray(Geometry=offset_on_srf, Plane=brep_brep.Curves, Count=3, Angle=6.283185307)  # -> flatten(Geometry), Transform
mirror_3 = Mirror(Geometry=[offset_on_srf, mirror_2.Geometry], Plane=xz_plane_2)  # -> Geometry, Transform
join_curves_2 = JoinCurves(Curves=[offset_on_srf, mirror_2.Geometry, mirror_3.Geometry], Preserve=False)  # -> flatten(Curves)
mesh_join = MeshJoin(Meshes=mesh_pipe)
mirror_4 = Mirror(Geometry=join_curves_2, Plane=xy_plane)  # -> Geometry, Transform
rotate_5 = Rotate(Geometry=[join_curves_2, mirror_4.Geometry], Angle=1.570796327, Plane=xz_plane_2)  # -> Geometry, Transform
join_curves_3 = JoinCurves(Curves=flatten(polar_array.Geometry), Preserve=False)  # -> flatten(Curves)
rotate_6 = Rotate(Geometry=[join_curves_2, mirror_4.Geometry], Angle=1.570796327, Plane=yz_plane)  # -> Geometry, Transform
join_curves_4 = JoinCurves(Curves=[join_curves_2, mirror_4.Geometry, rotate_6.Geometry, rotate_5.Geometry], Preserve=False)  # -> flatten(Curves)
curve_2 = Curve(polar_array.Geometry)
mirror_5 = Mirror(Geometry=join_curves_3, Plane=yz_plane)  # -> Geometry, Transform

parameter_pipe_mesh = ParameterPipeMesh(
    Curve=offset_on_srf,
    Radius=multiplication_7,
    ParametersU=range_4,
    ParametersV=range_3,
    Weighted=True,
    Lengths=False,
    Angle=0,
    Rotation=0,
    EndType=2,
    Triangulate=False)  # -> flatten(Piped)
mesh_join_2 = MeshJoin(Meshes=parameter_pipe_mesh)
panel_35 = Panel(mesh_join_2)

mirror_6 = Mirror(Geometry=join_curves_3, Plane=xy_plane)  # -> Geometry, Transform
mirror_7 = Mirror(Geometry=join_curves_3, Plane=xz_plane_2)  # -> Geometry, Transform
join_curves_5 = JoinCurves(Curves=flatten([join_curves_3, mirror_5.Geometry, mirror_6.Geometry, mirror_7.Geometry]), Preserve=False)  # -> flatten(Curves)
smooth_corners = SmoothCorners(Curve=join_curves_5, Parameter=Slider(2.000001, range=0..100), Continuity=1)  # -> flatten(CompoundCurve)
pipe_2 = Pipe(Curve=join_curves_3, Radius=multiplication_7, Caps=2)  # -> flatten(Pipe); disabled
offset_on_srf_2 = OffsetOnSrf(Curve=smooth_corners, Distance=1e-10, Surface=list_item)  # -> flatten(Curve); disabled
split_with_brep = SplitWithBrep(Curve=smooth_corners, Brep=list_item)  # -> Curve, Points
curve_3 = Curve(split_with_brep.Curve)
panel_36 = Panel(division_5)
mesh_pipe_2 = MeshPipe(Curve=line_sdl, Radius=division_5, Segments=Slider(8, range=0..10), Accuracy=1, CapType=3, Faceted=False)
mesh_explode = MeshExplode(Mesh=mesh_pipe_2, Interpolate=False)
list_item_14 = ListItem(List=line_sdl, Index=Slider(138, range=0..378), Wrap=True)
parameter_pipe_mesh_2 = ParameterPipeMesh(
    Curve=line_sdl,
    Radius=division_5,
    ParametersU=range_2,
    ParametersV=range,
    Weighted=False,
    Lengths=False,
    Angle=0,
    Rotation=0,
    EndType=2,
    Triangulate=False)
panel_37 = Panel(mesh_pipe_2)
bounding_box_3 = BoundingBox(Content=line_sdl, Plane=PlaneXY(0, 0, 0), UnionBox=True)  # -> Box, Box_2
cad_exporter = CADExporter(Export=False, ExportType="DXF", FilePaths="C:\", FileNames="FXD.DXF", Curves=line_sdl)
panel_38 = Panel(parameter_pipe_mesh_2)
mesh_explode_2 = MeshExplode(Mesh=parameter_pipe_mesh_2, Interpolate=False)
deconstruct_box_2 = DeconstructBox(Box=bounding_box_3.Box)  # -> Plane, X, Y, Z
deconstruct_domain_3 = DeconstructDomain(Domain=deconstruct_box_2.X)  # -> Start, End
deconstruct_domain_4 = DeconstructDomain(Domain=deconstruct_box_2.Y)  # -> Start, End
stream_filter_4 = StreamFilter(Gate=Slider(0, range=0..1), Stream0=mesh_pipe_2, Stream1=parameter_pipe_mesh_2)
absolute = Absolute(Value=deconstruct_domain_3.End)
absolute_2 = Absolute(Value=deconstruct_domain_3.Start)
absolute_3 = Absolute(Value=deconstruct_domain_4.Start)
absolute_4 = Absolute(Value=deconstruct_domain_4.End)
addition = Addition(A=absolute_2, B=absolute)
addition_2 = Addition(A=absolute_3, B=absolute_4)
division_8 = Division(A=addition_2, B=addition)
division_9 = Division(A=addition, B=addition_2)
panel_39 = Panel(division_9)
panel_40 = Panel(division_8)
brep = Brep(revolution)
group = Group(Objects=brep)
group_2 = Group(Objects=line_sdl)

number_slider_10 = Slider(10, range=0..10)
construct_point_3 = ConstructPoint(XCoordinate=0, YCoordinate=0, ZCoordinate=0)
division_10 = Division(A=number_slider_10, B="3")
import_obj = ImportOBJ(File="C:\JBO.PIH.FXD.FXD.DXF.DXF.HIP.OBJ", MapYtoZ=False, LastSaveLocalization="neutral,N")
ⵙ人ⵙᴥⵙ_ⵙᗱᗴⵙᙏⵙ_ⵙᗱᗴⵙᕤᕦⵙ_ⵙ_ⵙᕤᕦⵙᗱᗴⵙ_ⵙᙏⵙᗱᗴⵙ_ⵙᴥ = Slider(1, range=0..1)  # "ⵙ人ⵙᴥⵙ✤ⵙᗱᗴⵙᙏⵙⓄⵙᗱᗴⵙᕤᕦⵙ◯ⵙ◯ⵙᕤᕦⵙᗱᗴⵙⓄⵙᙏⵙᗱᗴⵙ✤ⵙᴥⵙ人ⵙ"
ⵙꕤⵙ_ⵙᴥⵙ_ⵙᴥⵙꖴⵙᙏⵙ_ⵙ_ⵙᙏⵙꖴⵙᴥⵙ_ⵙᴥⵙ_ⵙꕤⵙ = Slider(1, range=0..1)
ⵙꕤⵙ_ⵙ8ⵙ_ⵙᕤᕦⵙиnⵙꖴⵙᗝⵙиnⵙᑎⵙ_ⵙ8ⵙ_ⵙ_ⵙ8ⵙ_ⵙᑎⵙиn = Slider(0, range=0..1)  # "ⵙꕤⵙⓄⵙ8ⵙ◯ⵙᕤᕦⵙИNⵙꖴⵙᗝⵙИNⵙᑎⵙⓄⵙ8ⵙ◯ⵙ◯ⵙ8ⵙⓄⵙᑎⵙИNⵙᗝⵙꖴⵙИNⵙᕤᕦⵙ◯ⵙ8ⵙⓄⵙꕤ"
cone = Cone(Base=PlaneYZ(0, 0, 0), Radius=20, Length=80)  # -> Cone, Tip
weldmesh = WeldMesh(Mesh=import_obj, Radius=1e-10, Align=False, Use_RTree=False)
division_11 = Division(A=number_slider_10, B="9")
multiplication_8 = Multiplication(A=number_slider_10, B="sqrt(3)")
spiral = Spiral(
    BasePlane=Plane(origin=(0, 0, 0), x=(0, 1, 0), y=(-1, 0, 0)),
    Angle=31.41592654,
    Turns=division_11,
    BaseRadius=multiplication_8,
    PeakRadius=division_10)
pipe_3 = Pipe(Curve=spiral, Radius=number_slider_10, Caps=2)
multipipe = MultiPipe(
    Curves=spiral,
    NodeSize=division_11,
    EndOffset=division_10,
    StrutSize=division_11,
    Segment=0,
    KinkAngle=0.6,
    CubeFit=0,
    Caps=1)
stream_filter_5 = StreamFilter(Gate=Slider(1, range=0..2), Stream0=import_obj, Stream1=group_2, Stream2=multipipe)
geometry = Geometry(stream_filter_5)
bounding_box_4 = BoundingBox(Content=geometry, Plane=PlaneXY(0, 0, 0), UnionBox=True)  # -> Box, Box_2
center_geometry_at_origin = CenterGeometryAtOrigin(Geometry=bounding_box_4.Box)  # -> RecenteredGeometry, TranslationVector
stream_filter_6 = StreamFilter(Gate=ⵙꕤⵙ_ⵙ8ⵙ_ⵙᕤᕦⵙиnⵙꖴⵙᗝⵙиnⵙᑎⵙ_ⵙ8ⵙ_ⵙ_ⵙ8ⵙ_ⵙᑎⵙиn, Stream1=bounding_box_4.Box)
stream_filter_7 = StreamFilter(Gate=ⵙ人ⵙᴥⵙ_ⵙᗱᗴⵙᙏⵙ_ⵙᗱᗴⵙᕤᕦⵙ_ⵙ_ⵙᕤᕦⵙᗱᗴⵙ_ⵙᙏⵙᗱᗴⵙ_ⵙᴥ, Stream1=geometry)
move_2 = Move(Geometry=[stream_filter_7, stream_filter_6], Motion=center_geometry_at_origin.TranslationVector)  # -> Geometry, Transform
export_file_to_path = ExportFileToPath(Run=Toggle(False), GeometryToExport=move_2.Geometry, ExportPath="C:\T888......OBJ")
bounding_box_5 = BoundingBox(Content=move_2.Geometry, Plane=PlaneXY(0, 0, 0), UnionBox=True)  # -> Box, Box_2
geometry_2 = Geometry(move_2.Geometry)
deconstruct_box_3 = DeconstructBox(Box=bounding_box_5.Box)  # -> Plane, X, Y, Z
deconstruct_domain_5 = DeconstructDomain(Domain=deconstruct_box_3.Y)  # -> Start, End
deconstruct_domain_6 = DeconstructDomain(Domain=deconstruct_box_3.Z)  # -> Start, End
deconstruct_domain_7 = DeconstructDomain(Domain=deconstruct_box_3.X)  # -> Start, End
line_4 = Line(Line((-299.7957001, 0, 0), (-299.7957001, -99.65670013, 0)))
line_5 = Line(Line((-99.65670013, 0, 0), (-99.65670013, -0.001, 0)))
geometry_3 = Geometry(<mesh referenced from the Rhino model>)
reduce_mesh = ReduceMesh(Mesh=geometry_3, FaceCount=0, Accuracy=10, FaceType=1, Distort=False, Normalize=False)  # -> Reduced, CountDifference
move_3 = Move(Geometry=reduce_mesh.Reduced, Motion=Vector(-457.5, 0, 238.875))  # -> Geometry, Transform
taper = Taper(
    Geometry=reduce_mesh.Reduced,
    Axis=Line((-299.7957001, 0, 0), (-99.65670013, 0, 0)),
    Start=line_4,
    End=line_5,
    Flat=False,
    Infinite=False,
    Rigid=False)
move_4 = Move(Geometry=taper, Motion=Vector(-199.3134003, 0, 0))  # -> Geometry, Transform
scale_nu_2 = ScaleNU(Geometry=taper, Plane=PlaneXY(-1670.120177, 0, 0), ScaleX=0.7071067812, ScaleY=1, ScaleZ=1)  # -> Geometry, Transform

mesh_join_3 = MeshJoin(Meshes=import_obj)
yz_plane_3 = YZPlane(Origin=Point(0, 0, 0))
mirror_cut_mesh = MirrorCutMesh(
    Mesh=mesh_join_3,
    MirrorPlane=yz_plane_3,
    Reach=0,
    Offset=0,
    Flip=False,
    Join=False,
    Keep=False,
    ConnectionType=2,
    Bulge=0,
    Divisions=0,
    WeldVertices=0)  # -> MirrorCut, SplitIndex, ReachPlane, OffsetPlane, Intersected
mirror_8 = Mirror(Geometry=mirror_cut_mesh.MirrorCut, Plane=PlaneYZ(0, 0, 0))  # -> Geometry, Transform
mesh_join_4 = MeshJoin(Meshes=[mirror_8.Geometry, mirror_cut_mesh.MirrorCut])

division_12 = Division(A=division_5, B=deconstruct_domain_7.End)
addition_3 = Addition(A=division_12, B=1)
division_13 = Division(A=division_12, B=1)
addition_4 = Addition(A=division_13, B=1)
multiplication_9 = Multiplication(A=division_13, B=1.5)
addition_5 = Addition(A=multiplication_9, B=1)
multiplication_10 = Multiplication(A=addition_5, B=Slider(4, range=0..12))
multiplication_11 = Multiplication(A=addition_3, B=Slider(4, range=0..6))
multiplication_12 = Multiplication(A=addition_4, B=B)
multiplication_13 = Multiplication(A=addition_4, B=B_2)

multiplication_14 = Multiplication(A=deconstruct_domain_7.Start, B=multiplication_12)
multiplication_15 = Multiplication(A=deconstruct_domain_5.Start, B=multiplication_13)
addition_6 = Addition(A=multiplication_14, B=multiplication_15)

multiplication_16 = Multiplication(A=deconstruct_domain_5.Start, B="3")
addition_7 = Addition(A=deconstruct_domain_7.Start, B=multiplication_16)
addition_8 = Addition(A=addition_7, B=deconstruct_domain_6.Start)
addition_9 = Addition(A=multiplication_16, B=addition_8)

vector_xyz_2 = VectorXYZ(XComponent=0, YComponent=addition_7, ZComponent=addition_9)  # -> Vector, Length
move_5 = Move(Geometry=geometry_2, Motion=vector_xyz_2.Vector)  # -> Geometry, Transform

weldmesh_2 = WeldMesh(Mesh=mesh_join_4, Radius=1e-10, Align=False, Use_RTree=False)
multiplication_17 = Multiplication(A=deconstruct_domain_7.End, B=addition_3)

multiplication_18 = Multiplication(A=deconstruct_domain_7.Start, B=multiplication_11)
multiplication_19 = Multiplication(A=deconstruct_domain_5.Start, B=multiplication_10)
addition_10 = Addition(A=multiplication_19, B=multiplication_18)
division_14 = Division(A=addition_10, B=2)
addition_11 = Addition(A=deconstruct_domain_6.Start, B=division_14)
vector_xyz_3 = VectorXYZ(XComponent=multiplication_17, YComponent=addition_6, ZComponent=addition_11)  # -> Vector, Length
move_6 = Move(Geometry=geometry_2, Motion=vector_xyz_3.Vector)  # -> Geometry, Transform
mirror_9 = Mirror(Geometry=move_6.Geometry, Plane=PlaneYZ(0, 0, 0))  # -> Geometry, Transform

stream_filter_8 = StreamFilter(Gate=ⵙꕤⵙ_ⵙᴥⵙ_ⵙᴥⵙꖴⵙᙏⵙ_ⵙ_ⵙᙏⵙꖴⵙᴥⵙ_ⵙᴥⵙ_ⵙꕤⵙ, Stream0=move_5.Geometry, Stream1=[move_6.Geometry, mirror_9.Geometry])

polar_array_2 = PolarArray(Geometry=stream_filter_8, Plane=PlaneXY(0, 0, 0), Count=4, Angle=6.283185307)  # -> Geometry, Transform
rotate_7 = Rotate(Geometry=polar_array_2.Geometry, Angle=1.570796327, Plane=PlaneYZ(0, 0, 0))  # -> Geometry, Transform
polar_array_3 = PolarArray(Geometry=polar_array_2.Geometry, Plane=Plane(origin=(0, 0, 0), x=(0, 0, 1), y=(1, 0, 0)), Count=4, Angle=6.283185307)  # -> Geometry, Transform
rotate_8 = Rotate(Geometry=polar_array_2.Geometry, Angle=1.570796327, Plane=Plane(origin=(0, 0, 0), x=(0, -1, 0), y=(0, 0, 1)))  # -> Geometry, Transform

geometry_4 = Geometry(flatten([polar_array_3.Geometry, rotate_8.Geometry, rotate_7.Geometry]))
bounding_box_6 = BoundingBox(Content=geometry_4, Plane=PlaneXY(0, 0, 0), UnionBox=True)  # -> Box, Box_2
deconstruct_box_4 = DeconstructBox(Box=bounding_box_6.Box)  # -> Plane, X, Y, Z
panel_42 = Panel(deconstruct_box_4.X)
export_file_to_path_2 = ExportFileToPath(Run=Toggle(False), GeometryToExport=geometry_4, ExportPath="C:\JBO.BB42.XHG.FXD.FXD.DXF.DXF.GHX.24BB.OBJ")

ungroup = Ungroup(Group=geometry_4)  # -> flatten(Objects)
bounding_box_7 = BoundingBox(Content=ungroup, Plane=PlaneXY(0, 0, 0), UnionBox=True)  # -> Box, Box_2
mesh_join_5 = MeshJoin(Meshes=ungroup)  # -> flatten(Mesh)
deconstruct_box_5 = DeconstructBox(Box=bounding_box_7.Box)  # -> Plane, X, Y, Z

export_as = ExportAs(
    Geometry=mesh_join_5,
    FileLocation="C:\JBO.BB42.XHG.JBO.PIH.FXD.FXD.DXF.DXF.HIP.OBJ.GHX.24BB.OBJ",
    Overwrite=Toggle(False),
    Export=Toggle(False),
    CompMode=False,
    LastSaveLocalization="neutral,N")  # -> OK, ExportCommand
