# Grasshopper definition XHꓨ. ⊚◦୦◦◯◦୦◦⬡◦୦◦◯◦୦◦⊚ ⊚◦୦◦◯◦୦◦⬡◦୦◦◯◦୦◦⊚ .GHX (Grasshopper 1.0.7)
# plug-ins: Anemone, GraphicPlus, BlueOrange, Graphic Statics 3D, Heteroptera, Kangaroo2 Components, BullAnt, Flexibility.Gh-by Ehsan, BubalusGH2.0, CurvePlus, Pufferfish, Weaverbird, LunchBox

digit_scroller = DigitScroller(Scroller_Digits=12, Scroller_Prefix="Digit Scroller", Scroller_Radix=1, Scroller_Value=0.12830002)
triangular = Triangular(Plane=PlaneXY(-0.6735753001, -0.3888888746, 0), Size=digit_scroller, ExtentX=21, ExtentY=1)  # -> Cells, Points
digit_scroller_2 = DigitScroller(Scroller_Digits=12, Scroller_Prefix="Digit Scroller", Scroller_Radix=1, Scroller_Value=0.05555555555)
digit_scroller_3 = DigitScroller(Scroller_Digits=12, Scroller_Prefix="Digit Scroller", Scroller_Radix=1, Scroller_Value=0.384900179)
expression = Expression(Expression="2/(3*sqrt(3))/3/2")
expression_2 = Expression(Expression="2/(3*sqrt(3))/3/2/3")
negative = Negative(Value=expression)
negative_2 = Negative(Value=expression_2)
merge = Merge(Data1=negative, Data2=expression)  # -> graft(Result)
merge_2 = Merge(Data1=negative_2, Data2=expression_2)  # -> graft(Result)
indices = Indices([2, 5, 7])
number_slider = Slider(1, range=0..1)  # disabled
number_slider_2 = Slider(0, range=0..1)  # disabled
point = Point(Point(0, 0, 0))  # disabled
plane = Plane(PlaneXY(0, 0, 0))
rotate = Rotate(Geometry=plane, Angle=-1.570796327, Plane=PlaneXY(0, 0, 0))  # -> Geometry, Transform
sierpinski_fractal = SierpinskiFractal(Radius=8, Side=6, N=3, Deform=1)  # disabled
rectangle_2pt = Rectangle2Pt(Plane=PlaneXY(0, 0, 0), PointA=Point(0.5, 0.5, 0), PointB=Point(-0.5, -0.5, 0), Radius=0)  # -> Rectangle, Length; disabled
polygon = Polygon(Plane=PlaneXY(0, 0, 0), Radius=0.5, Segments=6, FilletRadius=0, Polygon=True)  # -> Polygon, Length; disabled
triangular_2 = Triangular(Plane=PlaneXY(0, 0, 0), Size=0.5, ExtentX=5, ExtentY=1)  # -> Cells, Points
division = Division(A=number_slider, B=2)  # disabled
circle = Circle(Plane=PlaneXY(0, 0, 0), Radius=division)  # disabled
geometry = Geometry(circle)  # disabled
scale = Scale(Geometry=geometry, Center=Point(0, 0, 0), Factor=0.3333333333)  # -> Geometry, Transform; disabled
divide_curve = DivideCurve(Curve=geometry, Count=2, Kinks=False)  # -> Points, Tangents, Parameters; disabled
divide_curve_2 = DivideCurve(Curve=geometry, Count=2, Kinks=False)  # -> Points, Tangents, Parameters; disabled
deconstruct_arc = DeconstructArc(Arc=geometry)  # -> BasePlane, Radius, Angle; disabled
polygon_2 = Polygon(Plane=PlaneXY(0, 0, 0), Radius=division, Segments=6, FilletRadius=0)  # -> Polygon, Length; disabled
point_2 = Point(deconstruct_arc.BasePlane)  # disabled
boundary_surfaces = BoundarySurfaces(Edges=rectangle_2pt.Rectangle)  # disabled
point_3 = Point(Point(0, 0, 0))  # disabled
fast_loop_start = FastLoopStart(Iterations=3, Data=geometry)  # -> port, Counter, Data; disabled
point_4 = Point(Point(0, 0, 0))  # disabled
stream_filter = StreamFilter(Gate=number_slider_2, Stream0=circle, Stream1=polygon_2.Polygon)  # disabled
merge_3 = Merge(Data1=point_2, Data2=divide_curve.Points)  # -> flatten(Result); disabled
division_2 = Division(A=Slider(1, range=0..1), B=2)
circumscribed_polygon = CircumscribedPolygon(Plane=rotate.Geometry, Radius=division_2, Sides=3)
scale_2 = Scale(Geometry=circumscribed_polygon, Center=Point(0, 0, 0), Factor=0.6666666667)  # -> Geometry, Transform
divide_curve_3 = DivideCurve(Curve=scale_2.Geometry, Count=54, Kinks=False)  # -> Points, Tangents, Parameters
scale_3 = Scale(Geometry=circumscribed_polygon, Center=Point(0, 0, 0), Factor=0.3333333333)  # -> Geometry, Transform
scale_4 = Scale(Geometry=scale_2.Geometry, Center=Point(0, 0, 0), Factor=digit_scroller_2)  # -> Geometry, Transform
orient = Orient(Geometry=scale_4.Geometry, Source=PlaneXY(0, 0, 0), Target=divide_curve_3.Points)  # -> Geometry, Transform
boundary_surfaces_2 = BoundarySurfaces(Edges=orient.Geometry)  # disabled
scale_5 = Scale(Geometry=circumscribed_polygon, Center=Point(0, 0, 0), Factor=0.8888888889)  # -> Geometry, Transform
scale_6 = Scale(Geometry=circumscribed_polygon, Center=Point(0, 0, 0), Factor=0.4444444444)  # -> Geometry, Transform
divide_curve_4 = DivideCurve(Curve=scale_5.Geometry, Count=162, Kinks=False)  # -> Points, Tangents, Parameters
scale_7 = Scale(Geometry=scale_2.Geometry, Center=Point(0, 0, 0), Factor=0.0185185185)  # -> Geometry, Transform
orient_2 = Orient(Geometry=scale_7.Geometry, Source=PlaneXY(0, 0, 0), Target=divide_curve_4.Points)  # -> Geometry, Transform
boundary_surfaces_3 = BoundarySurfaces(Edges=orient_2.Geometry)
divide_curve_5 = DivideCurve(Curve=scale_6.Geometry, Count=108, Kinks=False)  # -> Points, Tangents, Parameters
weaverbird_s_sierpinski_carpet = WeaverbirdsSierpinskiCarpet(MeshPolylines=circumscribed_polygon, Distance=expr("2/(3*sqrt(3))", 0.384900179), InsetType=1)
scale_8 = Scale(Geometry=scale_2.Geometry, Center=Point(0, 0, 0), Factor=0.0185185185)  # -> Geometry, Transform
orient_3 = Orient(Geometry=scale_8.Geometry, Source=PlaneXY(0, 0, 0), Target=divide_curve_5.Points)  # -> Geometry, Transform
boundary_surfaces_4 = BoundarySurfaces(Edges=orient_3.Geometry)
weaverbird_s_sierpinski_carpet_2 = WeaverbirdsSierpinskiCarpet(MeshPolylines=scale_2.Geometry, Distance=graft([-5.555555556, 5.555555556]), InsetType=0)  # disabled
face_boundaries = FaceBoundaries(Mesh=weaverbird_s_sierpinski_carpet)
weaverbird_s_sierpinski_carpet_3 = WeaverbirdsSierpinskiCarpet(MeshPolylines=scale_2.Geometry, Distance=merge, InsetType=1)
weaverbird_s_sierpinski_carpet_4 = WeaverbirdsSierpinskiCarpet(MeshPolylines=scale_2.Geometry, Distance=merge_2, InsetType=1)
weaverbird_s_split_triangles_subdivision = WeaverbirdsSplitTrianglesSubdivision(MeshCurves=circumscribed_polygon, Level=3)
discontinuity = Discontinuity(Curve=circumscribed_polygon, Level=1)  # -> Points, Parameters
merge_4 = Merge(Data1=divide_curve_2.Points, Data2=point)  # disabled
circle_2 = Circle(Plane=rotate.Geometry, Radius=division_2)
expression_3 = Expression(Expression="1/SQRT(3)")  # disabled
expression_4 = Expression(Expression=".5/3")  # disabled
expression_5 = Expression(Expression="1/2/SQRT(3)")  # disabled
expression_6 = Expression(Expression="1/3")  # disabled
rotate_2 = Rotate(Geometry=stream_filter, Angle=degrees(90), Plane=PlaneXY(0, 0, 0))  # -> Geometry, Transform; disabled
scale_9 = Scale(Geometry=boundary_surfaces, Center=Point(0, 0, 0), Factor=0.3333333333)  # -> Geometry, Transform; disabled
triangular_3 = Triangular(Plane=PlaneXY(0, 0, 0), Size=1, ExtentX=3, ExtentY=2)  # -> Cells, Points; disabled
explode = Explode(Curve=polygon.Polygon, Recursive=True)  # -> Segments, Vertices; disabled
divide_curve_6 = DivideCurve(Curve=rectangle_2pt.Rectangle, Count=8, Kinks=False)  # -> Points, Tangents, Parameters; disabled
boundary_surfaces_5 = BoundarySurfaces(Edges=rotate_2.Geometry)  # disabled
scale_10 = Scale(Geometry=boundary_surfaces_5, Center=Point(0, 0, 0), Factor=0.3333333333)  # -> Geometry, Transform; disabled
curve_middle = CurveMiddle(Curve=explode.Segments)  # disabled
merge_5 = Merge(Data2=curve_middle)  # -> flatten(Result); disabled
scale_11 = Scale(Geometry=graft(fast_loop_start.Data), Center=flatten(merge_3), Factor=0.3333333333)  # -> Geometry, Transform; disabled
digit_scroller_4 = DigitScroller(Scroller_Digits=12, Scroller_Prefix=" ", Scroller_Radix=11, Scroller_Value=3)  # disabled
fast_loop_start_2 = FastLoopStart(Iterations=digit_scroller_4, Data=scale.Geometry)  # -> port, Counter, Data; disabled
scale_12 = Scale(Geometry=graft(fast_loop_start_2.Data), Center=flatten(merge_4), Factor=0.3333333333)  # -> Geometry, Transform; disabled
rotate_3 = Rotate(Geometry=circle, Angle=degrees(90), Plane=PlaneXY(0, 0, 0))  # -> Geometry, Transform; disabled
divide_curve_7 = DivideCurve(Curve=rotate_3.Geometry, Count=6, Kinks=False)  # -> Points, Tangents, Parameters; disabled
cull_index = CullIndex(List=divide_curve_7.Points, Indices=[2, 4], Wrap=False)  # disabled
merge_6 = Merge(Data1=point_3, Data2=cull_index)  # -> flatten(Result); disabled
list_item = ListItem(List=divide_curve_7.Points, Index=3, Wrap=True)  # disabled
digit_scroller_5 = DigitScroller(Scroller_Digits=12, Scroller_Prefix="Digit Scroller", Scroller_Radix=11, Scroller_Value=2)  # disabled
divide_curve_8 = DivideCurve(Curve=rotate_2.Geometry, Count=6, Kinks=False)  # -> Points, Tangents, Parameters; disabled
scale_13 = Scale(Geometry=graft(polygon.Polygon), Center=merge_5, Factor=0.3333333333)  # -> Geometry, Transform; disabled
point_5 = Point(Point(0, 0, 0))  # disabled
button = Button()  # disabled
construct_point = ConstructPoint(XCoordinate=expression_6, YCoordinate=0, ZCoordinate=0)  # disabled
construct_point_2 = ConstructPoint(XCoordinate=0, YCoordinate=expression_5, ZCoordinate=0)  # disabled
scale_14 = Scale(Geometry=circle_2, Center=discontinuity.Points, Factor=0.3333333333)  # -> Geometry, Transform
scale_15 = Scale(Geometry=rotate_3.Geometry, Center=graft(merge_6), Factor=0.3333333333)  # -> flatten(Geometry), Transform; disabled
digit_scroller_6 = DigitScroller(Scroller_Digits=12, Scroller_Prefix="Digit Scroller", Scroller_Radix=11, Scroller_Value=1)  # disabled
fast_loop_start_3 = FastLoopStart(Iterations=digit_scroller_6, Data=scale_9.Geometry)  # -> port, Counter, Data; disabled
digit_scroller_7 = DigitScroller(Scroller_Digits=12, Scroller_Prefix="Digit Scroller", Scroller_Radix=11, Scroller_Value=2)  # disabled
merge_7 = Merge(Data2=divide_curve_8.Points)  # disabled
fast_loop_start_4 = FastLoopStart(Iterations=digit_scroller_7, Data=boundary_surfaces)  # -> port, Counter, Data; disabled
list_item_2 = ListItem(List=scale_15.Geometry, Index=1, Wrap=True)  # disabled
fast_loop_end = FastLoopEnd(port=fast_loop_start.port, Exit=False, Data=scale_11.Geometry, RecordData=True, TimeOutVal=0)  # disabled
fast_loop_end_2 = FastLoopEnd(port=fast_loop_start_2.port, Exit=False, Data=scale_12.Geometry, RecordData=True, TimeOutVal=0)  # disabled
button_2 = Button()  # disabled
circumscribed_polygon_2 = CircumscribedPolygon(Plane=rotate.Geometry, Radius=division_2, Sides=6)
scale_16 = Scale(Geometry=circumscribed_polygon_2, Center=Point(0, 0, 0), Factor=1)  # -> Geometry, Transform
fast_loop_start_5 = FastLoopStart(Iterations=0, Data=scale_16.Geometry)  # -> port, Counter, Data
scale_17 = Scale(Geometry=graft(fast_loop_start_5.Data), Center=discontinuity.Points, Factor=0.3333333333)  # -> Geometry, Transform
fast_loop_end_3 = FastLoopEnd(port=fast_loop_start_5.port, Exit=False, Data=scale_17.Geometry, RecordData=True, TimeOutVal=0)
merge_8 = Merge(Data1=scale_16.Geometry, Data2=fast_loop_end_3)
subdivide_triangle = SubdivideTriangle(TriangularCurve=merge_8, Subdivide=0, Boolean1=False, Boolean2=True, Boolean3=True, Boolean4=True, Wires=True)  # -> TriangleCellsA, TriangleCellsB
weaverbird_s_split_triangles_subdivision_2 = WeaverbirdsSplitTrianglesSubdivision(MeshCurves=merge_8, Level=3)
face_boundaries_2 = FaceBoundaries(Mesh=weaverbird_s_split_triangles_subdivision_2)
cull_index_2 = CullIndex(List=face_boundaries_2, Indices=indices, Wrap=True)
list_item_3 = ListItem(List=face_boundaries_2, Index=indices, Wrap=True)
weaverbird_s_sierpinski_triangles_subdiv = WeaverbirdsSierpinskiTrianglesSubdivision(MeshCurves=merge_8, Level=2)
recursive_transform = RecursiveTransform(Geometry=scale_16.Geometry, Transform=scale_14.Transform, Steps=4, Last=False)  # disabled
merge_9 = Merge(Data1=merge_8)  # -> flatten(Result)
mirror_curve = MirrorCurve(Geometry=merge_8, Curve=circumscribed_polygon_2, Tangent=True)  # disabled
explode_2 = Explode(Curve=circumscribed_polygon_2, Recursive=True)  # -> Segments, Vertices
scale_18 = Scale(Geometry=graft(fast_loop_start_3.Data), Center=flatten(divide_curve_6.Points), Factor=0.3333333333)  # -> Geometry, Transform; disabled
merge_10 = Merge(Data1=scale.Geometry, Data2=fast_loop_end_2)  # disabled
digit_scroller_8 = DigitScroller(Scroller_Digits=12, Scroller_Prefix="Digit Scroller", Scroller_Radix=11, Scroller_Value=1)  # disabled
fast_loop_start_6 = FastLoopStart(Iterations=digit_scroller_8, Data=boundary_surfaces_5)  # -> port, Counter, Data; disabled
divide_curve_9 = DivideCurve(Curve=list_item_2, Count=2, Kinks=False)  # -> Points, Tangents, Parameters; disabled
explode_3 = Explode(Curve=scale_13.Geometry, Recursive=True)  # -> Segments, Vertices; disabled
scale_19 = Scale(Geometry=fast_loop_end, Center=construct_point_2, Factor=1)  # -> Geometry, Transform; disabled
move = Move(Geometry=fast_loop_end, Motion=construct_point)  # -> Geometry, Transform; disabled
point_6 = Point(Point(0, 0, 0))  # disabled
deconstruct_arc_2 = DeconstructArc(Arc=scale_15.Geometry)  # -> BasePlane, Radius, Angle; disabled
deconstruct_arc_3 = DeconstructArc(Arc=fast_loop_end_2)  # -> BasePlane, Radius, Angle; disabled
scale_20 = Scale(Geometry=graft(fast_loop_start_4.Data), Center=flatten(divide_curve_6.Points), Factor=0.3333333333)  # -> Geometry, Transform; disabled
deconstruct_arc_4 = DeconstructArc(Arc=list_item_2)  # -> BasePlane, Radius, Angle; disabled
curve_middle_2 = CurveMiddle(Curve=explode_3.Segments)  # disabled
merge_11 = Merge(Data1=simplify(flatten(point_6)), Data2=simplify(flatten(curve_middle_2)))  # disabled
scale_21 = Scale(Geometry=graft(fast_loop_start_6.Data), Center=flatten(divide_curve_8.Points), Factor=0.3333333333)  # -> Geometry, Transform; disabled
scale_22 = Scale(Geometry=scale_15.Geometry, Center=graft(deconstruct_arc_2.BasePlane), Factor=0.3333333333)  # -> Geometry, Transform; disabled
deconstruct = Deconstruct(Point=deconstruct_arc_3.BasePlane)  # -> XComponent, YComponent, ZComponent; disabled
larger_than = LargerThan(FirstNumber=deconstruct.XComponent, SecondNumber=0)  # -> LargerThan, OrEqualTo; disabled
expression_7 = Expression(Expression=".5/3")  # disabled
scale_23 = Scale(Geometry=scale_13.Geometry, Center=graft(merge_5), Factor=0.3333333333)  # -> Geometry, Transform; disabled
circumscribed_polygon_3 = CircumscribedPolygon(Plane=PlaneXY(0, 0, 0), Radius=1, Sides=6)
scale_24 = Scale(Geometry=circumscribed_polygon_3, Center=Point(0, 0, 0), Factor=0.8888888889)  # -> Geometry, Transform
scale_25 = Scale(Geometry=circumscribed_polygon_3, Center=Point(0, 0, 0), Factor=0.6666666667)  # -> Geometry, Transform
scale_26 = Scale(Geometry=circumscribed_polygon_3, Center=Point(0, 0, 0), Factor=0.4444444444)  # -> Geometry, Transform
divide_curve_10 = DivideCurve(Curve=scale_24.Geometry, Count=144, Kinks=False)  # -> Points, Tangents, Parameters
divide_curve_11 = DivideCurve(Curve=scale_25.Geometry, Count=36, Kinks=True)  # -> Points, Tangents, Parameters
divide_curve_12 = DivideCurve(Curve=scale_26.Geometry, Count=72, Kinks=False)  # -> Points, Tangents, Parameters
scale_27 = Scale(Geometry=scale_25.Geometry, Center=Point(0, 0, 0), Factor=0.1666666667)  # -> Geometry, Transform
orient_4 = Orient(Geometry=scale_27.Geometry, Source=PlaneXY(0, 0, 0), Target=divide_curve_11.Points)  # -> Geometry, Transform
scale_28 = Scale(Geometry=scale_27.Geometry, Center=Point(0, 0, 0), Factor=0.3333333333)  # -> Geometry, Transform
orient_5 = Orient(Geometry=scale_28.Geometry, Source=PlaneXY(0, 0, 0), Target=divide_curve_10.Points)  # -> Geometry, Transform
orient_6 = Orient(Geometry=scale_28.Geometry, Source=PlaneXY(0, 0, 0), Target=divide_curve_12.Points)  # -> Geometry, Transform
tri_fan_polyline = TriFanPolyline(Polyline=orient_5.Geometry)  # -> flatten(Polylines)
tri_fan_polyline_2 = TriFanPolyline(Polyline=orient_4.Geometry)  # -> flatten(Polylines)
tri_fan_polyline_3 = TriFanPolyline(Polyline=orient_6.Geometry)  # -> flatten(Polylines)
explode_4 = Explode(Curve=tri_fan_polyline, Recursive=True)  # -> flatten(Segments), Vertices
explode_5 = Explode(Curve=tri_fan_polyline_2, Recursive=True)  # -> flatten(Segments), Vertices
explode_6 = Explode(Curve=tri_fan_polyline_3, Recursive=True)  # -> flatten(Segments), Vertices
ggnetworkpolygons = GgNetworkPolygons(Curves=explode_4.Segments, PerimOrVoid=3)
ggnetworkpolygons_2 = GgNetworkPolygons(Curves=explode_5.Segments, PerimOrVoid=3)
weaverbird_s_split_triangles_subdivision_3 = WeaverbirdsSplitTrianglesSubdivision(MeshCurves=ggnetworkpolygons_2, Level=3)
face_boundaries_3 = FaceBoundaries(Mesh=weaverbird_s_split_triangles_subdivision_3)
ggnetworkpolygons_3 = GgNetworkPolygons(Curves=explode_6.Segments, PerimOrVoid=3)
weaverbird_s_split_triangles_subdivision_4 = WeaverbirdsSplitTrianglesSubdivision(MeshCurves=ggnetworkpolygons_2, Level=3)  # disabled
merge_12 = Merge(Data1=ggnetworkpolygons_2, Data2=ggnetworkpolygons, Data3=ggnetworkpolygons_3)
parameter_pipe_mesh = ParameterPipeMesh(
    Curve=scale_25.Geometry,
    Radius=0.1111111111,
    ParametersU=[0, 0.1666666667, 0.3333333333, 0.5, 0.6666666667, 0.8333333333, 1],
    ParametersV=[0, 0.1666666667, 0.3333333333, 0.5, 0.6666666667, 0.8333333333, 1],
    Weighted=False,
    Lengths=True,
    Angle=0,
    Rotation=15,
    EndType=0,
    Triangulate=False)  # disabled
face_boundaries_4 = FaceBoundaries(Mesh=parameter_pipe_mesh)
triangle_mapping = TriangleMapping(Geometry=flatten(merge_8), Source=circumscribed_polygon, Target=graft(merge_12))  # -> flatten(Geometry), Transform
boundary_surfaces_6 = BoundarySurfaces(Edges=triangle_mapping.Geometry)
scale_29 = Scale(Geometry=circumscribed_polygon_2, Center=Point(0, 0, 0), Factor=0.3333333333)  # -> Geometry, Transform
number_slider_3 = Slider(1, range=0..1)  # disabled
merge_13 = Merge(Data1=deconstruct_arc_4.BasePlane, Data2=divide_curve_9.Points)  # disabled
deconstruct_arc_5 = DeconstructArc(Arc=triangle_mapping.Geometry)  # -> BasePlane, Radius, Angle
sort_list = SortList(Keys=deconstruct_arc_5.Radius)  # -> reverse(Keys), ValuesValuesA
panel = Panel(sort_list.Keys)
polar_array = PolarArray(Geometry=move.Geometry, Plane=PlaneXY(0, 0, 0), Count=6, Angle=6.283185307)  # -> Geometry, Transform; disabled
fast_loop_end_4 = FastLoopEnd(port=fast_loop_start_3.port, Exit=False, Data=scale_18.Geometry, RecordData=True, TimeOutVal=0)  # disabled
fast_loop_start_7 = FastLoopStart(Iterations=2, Data=scale_29.Geometry)  # -> port, Counter, Data
cull_pattern = CullPattern(List=fast_loop_end_2, CullPattern=larger_than.OrEqualTo)  # disabled
scale_30 = Scale(Geometry=cull_pattern, Center=Point(0.5, 0, 0), Factor=0.3333333333)  # -> Geometry, Transform; disabled
fast_loop_end_5 = FastLoopEnd(port=fast_loop_start_4.port, Exit=False, Data=scale_20.Geometry, RecordData=False, TimeOutVal=0)  # disabled
construct_point_3 = ConstructPoint(XCoordinate=0, YCoordinate=expression_3, ZCoordinate=0)  # disabled
move_2 = Move(Geometry=fast_loop_end, Motion=construct_point_3)  # -> Geometry, Transform; disabled
tri_fan_polyline_4 = TriFanPolyline(Polyline=circumscribed_polygon_3)
point_7 = Point(merge_13)  # disabled
fast_loop_end_6 = FastLoopEnd(port=fast_loop_start_6.port, Exit=False, Data=scale_21.Geometry, RecordData=False, TimeOutVal=0)  # disabled
scale_31 = Scale(Geometry=list_item_2, Center=flatten(point_7), Factor=0.3333333333)  # -> Geometry, Transform; disabled
sphere = Sphere(Base=PlaneXY(0, 0, 0), Radius=0.5)  # disabled
digit_scroller_9 = DigitScroller(Scroller_Digits=12, Scroller_Prefix="Digit Scroller", Scroller_Radix=11, Scroller_Value=18)
scale_32 = Scale(Geometry=flatten(scale_23.Geometry), Center=graft(merge_5), Factor=0.3333333333)  # -> Geometry, Transform; disabled
polar_array_2 = PolarArray(Geometry=cull_pattern, Plane=PlaneXY(0, 0, 0), Count=6, Angle=6.283185307)  # -> Geometry, Transform; disabled
weaverbird_s_split_triangles_subdivision_5 = WeaverbirdsSplitTrianglesSubdivision(MeshCurves=tri_fan_polyline_4, Level=3)
subdivide_triangle_2 = SubdivideTriangle(TriangularCurve=tri_fan_polyline_4, Subdivide=0, Boolean1=True, Boolean2=True, Boolean3=True, Boolean4=True, Wires=True)  # -> TriangleCellsA, TriangleCellsB
weaverbird_s_sierpinski_triangles_subdiv_2 = WeaverbirdsSierpinskiTrianglesSubdivision(MeshCurves=tri_fan_polyline_4, Level=0)
polar_array_3 = PolarArray(Geometry=move_2.Geometry, Plane=PlaneXY(0, 0, 0), Count=6, Angle=6.283185307)  # -> Geometry, Transform; disabled
curve_middle_3 = CurveMiddle(Curve=explode_2.Segments)
point_8 = Point(Point(0, 0, 0))
geometry_2 = Geometry(fast_loop_end_6)  # disabled
list_item_4 = ListItem(List=flatten(scale_15.Geometry), Index=0, Wrap=True)  # disabled
digit_scroller_10 = DigitScroller(Scroller_Digits=12, Scroller_Prefix="Digit Scroller", Scroller_Radix=11, Scroller_Value=1)  # disabled
bounding_rectangle = BoundingRectangle(Content={Plane=PlaneXY(0, 0, 0), Radius=0.5}, Plane=PlaneXY(0, 0, 0), UnionRec=True)  # disabled
scale_33 = Scale(Geometry=fast_loop_end_6, Center=Point(0, 0, 0), Factor=0.3333333333)  # -> Geometry, Transform; disabled
scale_34 = Scale(Geometry=flatten(scale_32.Geometry), Center=graft(merge_5), Factor=0.3333333333)  # -> Geometry, Transform; disabled
polar_array_4 = PolarArray(Geometry=scale_31.Geometry, Plane=PlaneXY(0, 0, 0), Count=6, Angle=6.283185307)  # -> Geometry, Transform; disabled
divide_curve_13 = DivideCurve(Curve=list_item_4, Count=6, Kinks=False)  # -> Points, Tangents, Parameters; disabled
custom_preview = CustomPreview(
    Geometry=geometry_2,
    Material={diffuse=RGB(211, 222, 160), emission=RGB(63, 67, 48), shine=0.5, specular=RGB(255, 255, 255), transparency=0})  # disabled
merge_14 = Merge(Data2=curve_middle_3)
scale_35 = Scale(Geometry=graft(fast_loop_start_7.Data), Center=flatten(merge_14), Factor=0.3333333333)  # -> Geometry, Transform
merge_15 = Merge(Data1=fast_loop_start_7.Data, Data2=scale_35.Geometry)
boundary_surfaces_7 = BoundarySurfaces(Edges=scale_34.Geometry)  # disabled
boundary_surfaces_8 = BoundarySurfaces(Edges=triangle_mapping.Geometry)  # disabled
deconstruct_arc_6 = DeconstructArc(Arc=list_item_4)  # -> BasePlane, Radius, Angle; disabled
fast_loop_end_7 = FastLoopEnd(port=fast_loop_start_7.port, Exit=False, Data=scale_35.Geometry, RecordData=True, TimeOutVal=0)
scale_36 = Scale(Geometry=fast_loop_end_7, Center=Point(0, 0, 0), Factor=0.3333333333)  # -> Geometry, Transform; disabled
brep_centroid = BrepCentroid(Brep=sphere)  # disabled
geometry_3 = Geometry(subdivide_triangle_2.TriangleCellsB)
area = Area(Geometry=subdivide_triangle_2.TriangleCellsB)  # -> Area, Centroid
face_boundaries_5 = FaceBoundaries(Mesh=weaverbird_s_split_triangles_subdivision_5)
list_item_5 = ListItem(List=face_boundaries_5, Index=digit_scroller_9, Wrap=True)  # disabled
boundary_surfaces_9 = BoundarySurfaces(Edges=list_item_5)  # disabled
fast_loop_start_8 = FastLoopStart(Iterations=0, Data=sphere, D1=brep_centroid)  # -> port, Counter, Data, Data_2, Data_3; disabled
cull_index_3 = CullIndex(List=face_boundaries_5, Indices=[0, 9, 18, 27, 36, 45], Wrap=False)
recursive_transform_2 = RecursiveTransform(Geometry=scale_36.Geometry, Transform=scale_36.Transform, Steps=3, Last=False)  # disabled
boundary_surfaces_10 = BoundarySurfaces()  # disabled
cull_index_4 = CullIndex(List=divide_curve_13.Points, Indices=[2, 4], Wrap=False)  # disabled
cull_index_5 = CullIndex(List=polar_array_2.Geometry, Indices=[2, 4], Wrap=False)  # disabled
merge_16 = Merge(Data1=scale.Geometry, Data2=cull_index_5)  # disabled
stream_filter_2 = StreamFilter(Gate=2, Stream0=scale.Geometry, Stream1=cull_index_5, Stream2=merge_16)  # disabled
scale_37 = Scale(Geometry=stream_filter_2, Center=Point(-0.5, 0, 0), Factor=0.3333333333)  # -> Geometry, Transform; disabled
merge_17 = Merge(Data1=subdivide_triangle_2.TriangleCellsA, Data2=subdivide_triangle_2.TriangleCellsB)
custom_preview_2 = CustomPreview(
    Geometry=boundary_surfaces_10,
    Material={diffuse=RGB(68, 255, 0), emission=RGB(20, 76, 0), shine=0.5, specular=RGB(255, 255, 255), transparency=0})  # disabled
merge_18 = Merge(Data2=fast_loop_end_7)
merge_19 = Merge(Data1=fast_loop_end_7, Data2=recursive_transform_2)  # disabled
series = Series(Start=0, Step=1, Count=2)  # -> graft(Series); disabled
weaverbird_s_split_triangles_subdivision_6 = WeaverbirdsSplitTrianglesSubdivision(MeshCurves=cull_index_3, Level=3)

line = Line(Tree({0;0;0}: [Line((0, 0, 0), (0, 0.3333333333, 0)), Line((0, 0, 0), (-0.2886751354, 0.1666666652, 0)), Line((0, 0, 0), (-0.2886751355, -0.1666666651, 0)), Line((0, 0, 0), (0, -0.3333333333, 0)), Line((0, 0, 0), (0.2886751354, -0.1666666652, 0)), Line((0, 0, 0), (0.2886751355, 0.1666666651, 0))], {1;0;0;0}: [Line((0, 0.3333333333, 0), (0, 0.4444444444, 0)), Line((-0.2886751354, 0.1666666652, 0), (-0.2886751354, 0.2777777763, 0)), Line((-0.2886751355, -0.1666666651, 0), (-0.2886751355, -0.05555555396, 0)), Line((0, -0.3333333333, 0), (0, -0.2222222222, 0)), Line((0.2886751354, -0.1666666652, 0), (0.2886751354, -0.05555555412, 0)), Line((0.2886751355, 0.1666666651, 0), (0.2886751355, 0.2777777762, 0))], {1;0;0;1}: [Line((0, 0.3333333333, 0), (-0.09622504514, 0.3888888884, 0)), Line((-0.2886751354, 0.1666666652, 0), (-0.3849001806, 0.2222222203, 0)), Line((-0.2886751355, -0.1666666651, 0), (-0.3849001807, -0.11111111, 0)), Line((0, -0.3333333333, 0), (-0.09622504514, -0.2777777783, 0)), Line((0.2886751354, -0.1666666652, 0), (0.1924500903, -0.1111111102, 0)), Line((0.2886751355, 0.1666666651, 0), (0.1924500904, 0.2222222201, 0))], {1;0;0;2}: [Line((0, 0.3333333333, 0), (-0.09622504517, 0.2777777783, 0)), Line((-0.2886751354, 0.1666666652, 0), (-0.3849001806, 0.1111111102, 0)), Line((-0.2886751355, -0.1666666651, 0), (-0.3849001807, -0.2222222201, 0)), Line((0, -0.3333333333, 0), (-0.09622504517, -0.3888888884, 0)), Line((0.2886751354, -0.1666666652, 0), (0.1924500903, -0.2222222203, 0)), Line((0.2886751355, 0.1666666651, 0), (0.1924500903, 0.11111111, 0))], {1;0;0;3}: [Line((0, 0.3333333333, 0), (0, 0.2222222222, 0)), Line((-0.2886751354, 0.1666666652, 0), (-0.2886751354, 0.05555555412, 0)), Line((-0.2886751355, -0.1666666651, 0), (-0.2886751355, -0.2777777762, 0)), Line((0, -0.3333333333, 0), (0, -0.4444444444, 0)), Line((0.2886751354, -0.1666666652, 0), (0.2886751354, -0.2777777763, 0)), Line((0.2886751355, 0.1666666651, 0), (0.2886751355, 0.05555555396, 0))], {1;0;0;4}: [Line((0, 0.3333333333, 0), (0.09622504514, 0.2777777783, 0)), Line((-0.2886751354, 0.1666666652, 0), (-0.1924500903, 0.1111111102, 0)), Line((-0.2886751355, -0.1666666651, 0), (-0.1924500904, -0.2222222201, 0)), Line((0, -0.3333333333, 0), (0.09622504514, -0.3888888884, 0)), Line((0.2886751354, -0.1666666652, 0), (0.3849001806, -0.2222222203, 0)), Line((0.2886751355, 0.1666666651, 0), (0.3849001807, 0.11111111, 0))], {1;0;0;5}: [Line((0, 0.3333333333, 0), (0.09622504517, 0.3888888884, 0)), Line((-0.2886751354, 0.1666666652, 0), (-0.1924500903, 0.2222222203, 0)), Line((-0.2886751355, -0.1666666651, 0), (-0.1924500903, -0.11111111, 0)), Line((0, -0.3333333333, 0), (0.09622504517, -0.2777777783, 0)), Line((0.2886751354, -0.1666666652, 0), (0.3849001806, -0.1111111102, 0)), Line((0.2886751355, 0.1666666651, 0), (0.3849001807, 0.2222222201, 0))]))  # disabled
line_2 = Line(Tree({0}: [Line((0, 0.3333333333, 0), (0, 0.3333333333, 0)), Line((-0.2886751354, 0.1666666652, 0), (-0.2886751354, 0.1666666652, 0)), Line((-0.2886751355, -0.1666666651, 0), (-0.2886751355, -0.1666666651, 0)), Line((0, -0.3333333333, 0), (0, -0.3333333333, 0)), Line((0.2886751354, -0.1666666652, 0), (0.2886751354, -0.1666666652, 0)), Line((0.2886751355, 0.1666666651, 0), (0.2886751355, 0.1666666651, 0))], {1;0}: [Line((0, 0.4444444444, 0), (0, 0.4444444444, 0)), Line((-0.2886751354, 0.2777777763, 0), (-0.2886751354, 0.2777777763, 0)), Line((-0.2886751355, -0.05555555396, 0), (-0.2886751355, -0.05555555396, 0)), Line((0, -0.2222222222, 0), (0, -0.2222222222, 0)), Line((0.2886751354, -0.05555555412, 0), (0.2886751354, -0.05555555412, 0)), Line((0.2886751355, 0.2777777762, 0), (0.2886751355, 0.2777777762, 0))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], {2;0;0}: [Line((0, 0.4814814815, 0), (0, 0.4814814815, 0)), Line((-0.2886751354, 0.3148148134, 0), (-0.2886751354, 0.3148148134, 0)), Line((-0.2886751355, -0.01851851692, 0), (-0.2886751355, -0.01851851692, 0)), Line((0, -0.1851851852, 0), (0, -0.1851851852, 0)), Line((0.2886751354, -0.01851851708, 0), (0.2886751354, -0.01851851708, 0)), Line((0.2886751355, 0.3148148132, 0), (0.2886751355, 0.3148148132, 0))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], {3;0;0;0}: [Line((0, 0.4814814815, 0), (0, 0.4938271605, 0)), Line((-0.2886751354, 0.3148148134, 0), (-0.2886751354, 0.3271604924, 0)), Line((-0.2886751355, -0.01851851692, 0), (-0.2886751355, -0.006172837907, 0)), Line((0, -0.1851851852, 0), (0, -0.1728395062, 0)), Line((0.2886751354, -0.01851851708, 0), (0.2886751354, -0.006172838068, 0)), Line((0.2886751355, 0.3148148132, 0), (0.2886751355, 0.3271604922, 0))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], {3;0;0;1}: [Line((0, 0.4814814815, 0), (-0.01069167168, 0.4876543209, 0)), Line((-0.2886751354, 0.3148148134, 0), (-0.2993668071, 0.3209876528, 0)), Line((-0.2886751355, -0.01851851692, 0), (-0.2993668072, -0.01234567747, 0)), Line((0, -0.1851851852, 0), (-0.01069167168, -0.1790123457, 0)), Line((0.2886751354, -0.01851851708, 0), (0.2779834637, -0.01234567763, 0)), Line((0.2886751355, 0.3148148132, 0), (0.2779834638, 0.3209876527, 0))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], {3;0;0;2}: [Line((0, 0.4814814815, 0), (-0.01069167169, 0.475308642, 0)), Line((-0.2886751354, 0.3148148134, 0), (-0.2993668071, 0.3086419739, 0)), Line((-0.2886751355, -0.01851851692, 0), (-0.2993668072, -0.02469135637, 0)), Line((0, -0.1851851852, 0), (-0.01069167169, -0.1913580246, 0)), Line((0.2886751354, -0.01851851708, 0), (0.2779834637, -0.02469135653, 0)), Line((0.2886751355, 0.3148148132, 0), (0.2779834638, 0.3086419738, 0))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], {3;0;0;3}: [Line((0, 0.4814814815, 0), (0, 0.4691358025, 0)), Line((-0.2886751354, 0.3148148134, 0), (-0.2886751354, 0.3024691344, 0)), Line((-0.2886751355, -0.01851851692, 0), (-0.2886751355, -0.03086419593, 0)), Line((0, -0.1851851852, 0), (0, -0.1975308642, 0)), Line((0.2886751354, -0.01851851708, 0), (0.2886751354, -0.03086419609, 0)), Line((0.2886751355, 0.3148148132, 0), (0.2886751355, 0.3024691342, 0))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], {3;0;0;4}: [Line((0, 0.4814814815, 0), (0.01069167168, 0.475308642, 0)), Line((-0.2886751354, 0.3148148134, 0), (-0.2779834637, 0.3086419739, 0)), Line((-0.2886751355, -0.01851851692, 0), (-0.2779834638, -0.02469135637, 0)), Line((0, -0.1851851852, 0), (0.01069167168, -0.1913580246, 0)), Line((0.2886751354, -0.01851851708, 0), (0.2993668071, -0.02469135653, 0)), Line((0.2886751355, 0.3148148132, 0), (0.2993668072, 0.3086419738, 0))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], {3;0;0;5}: [Line((0, 0.4814814815, 0), (0.01069167169, 0.4876543209, 0)), Line((-0.2886751354, 0.3148148134, 0), (-0.2779834637, 0.3209876528, 0)), Line((-0.2886751355, -0.01851851692, 0), (-0.2779834638, -0.01234567747, 0)), Line((0, -0.1851851852, 0), (0.01069167169, -0.1790123457, 0)), Line((0.2886751354, -0.01851851708, 0), (0.2993668071, -0.01234567763, 0)), Line((0.2886751355, 0.3148148132, 0), (0.2993668072, 0.3209876527, 0))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]))  # disabled
line_3 = Line(Tree({1}: [Line((0, 0.4444444444, 0), (0, 0.4444444444, 0)), Line((-0.2886751354, 0.2777777763, 0), (-0.2886751354, 0.2777777763, 0)), Line((-0.2886751355, -0.05555555396, 0), (-0.2886751355, -0.05555555396, 0)), Line((0, -0.2222222222, 0), (0, -0.2222222222, 0)), Line((0.2886751354, -0.05555555412, 0), (0.2886751354, -0.05555555412, 0)), Line((0.2886751355, 0.2777777762, 0), (0.2886751355, 0.2777777762, 0))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], {2;0}: [Line((0, 0.4814814815, 0), (0, 0.4814814815, 0)), Line((-0.2886751354, 0.3148148134, 0), (-0.2886751354, 0.3148148134, 0)), Line((-0.2886751355, -0.01851851692, 0), (-0.2886751355, -0.01851851692, 0)), Line((0, -0.1851851852, 0), (0, -0.1851851852, 0)), Line((0.2886751354, -0.01851851708, 0), (0.2886751354, -0.01851851708, 0)), Line((0.2886751355, 0.3148148132, 0), (0.2886751355, 0.3148148132, 0))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], {3;0;0}: [Line((0, 0.4938271605, 0), (0, 0.4938271605, 0)), Line((-0.2886751354, 0.3271604924, 0), (-0.2886751354, 0.3271604924, 0)), Line((-0.2886751355, -0.006172837907, 0), (-0.2886751355, -0.006172837907, 0)), Line((0, -0.1728395062, 0), (0, -0.1728395062, 0)), Line((0.2886751354, -0.006172838068, 0), (0.2886751354, -0.006172838068, 0)), Line((0.2886751355, 0.3271604922, 0), (0.2886751355, 0.3271604922, 0))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], {4;0;0;0}: [Line((0, 0.4938271605, 0), (0, 0.4979423868, 0)), Line((-0.2886751354, 0.3271604924, 0), (-0.2886751354, 0.3312757187, 0)), Line((-0.2886751355, -0.006172837907, 0), (-0.2886751355, -0.00205761157, 0)), Line((0, -0.1728395062, 0), (0, -0.1687242798, 0)), Line((0.2886751354, -0.006172838068, 0), (0.2886751354, -0.002057611731, 0)), Line((0.2886751355, 0.3271604922, 0), (0.2886751355, 0.3312757186, 0))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], {4;0;0;1}: [Line((0, 0.4938271605, 0), (-0.003563890561, 0.4958847736, 0)), Line((-0.2886751354, 0.3271604924, 0), (-0.292239026, 0.3292181055, 0)), Line((-0.2886751355, -0.006172837907, 0), (-0.2922390261, -0.004115224756, 0)), Line((0, -0.1728395062, 0), (-0.003563890561, -0.170781893, 0)), Line((0.2886751354, -0.006172838068, 0), (0.2851112449, -0.004115224917, 0)), Line((0.2886751355, 0.3271604922, 0), (0.285111245, 0.3292181054, 0))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], {4;0;0;2}: [Line((0, 0.4938271605, 0), (-0.003563890562, 0.4917695473, 0)), Line((-0.2886751354, 0.3271604924, 0), (-0.292239026, 0.3251028792, 0)), Line((-0.2886751355, -0.006172837907, 0), (-0.2922390261, -0.008230451056, 0)), Line((0, -0.1728395062, 0), (-0.003563890562, -0.1748971193, 0)), Line((0.2886751354, -0.006172838068, 0), (0.2851112449, -0.008230451217, 0)), Line((0.2886751355, 0.3271604922, 0), (0.285111245, 0.3251028791, 0))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], {4;0;0;3}: [Line((0, 0.4938271605, 0), (0, 0.4897119342, 0)), Line((-0.2886751354, 0.3271604924, 0), (-0.2886751354, 0.3230452661, 0)), Line((-0.2886751355, -0.006172837907, 0), (-0.2886751355, -0.01028806424, 0)), Line((0, -0.1728395062, 0), (0, -0.1769547325, 0)), Line((0.2886751354, -0.006172838068, 0), (0.2886751354, -0.01028806441, 0)), Line((0.2886751355, 0.3271604922, 0), (0.2886751355, 0.3230452659, 0))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], {4;0;0;4}: [Line((0, 0.4938271605, 0), (0.003563890561, 0.4917695473, 0)), Line((-0.2886751354, 0.3271604924, 0), (-0.2851112449, 0.3251028792, 0)), Line((-0.2886751355, -0.006172837907, 0), (-0.285111245, -0.008230451058, 0)), Line((0, -0.1728395062, 0), (0.003563890561, -0.1748971193, 0)), Line((0.2886751354, -0.006172838068, 0), (0.292239026, -0.008230451219, 0)), Line((0.2886751355, 0.3271604922, 0), (0.2922390261, 0.3251028791, 0))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], {4;0;0;5}: [Line((0, 0.4938271605, 0), (0.003563890562, 0.4958847736, 0)), Line((-0.2886751354, 0.3271604924, 0), (-0.2851112449, 0.3292181055, 0)), Line((-0.2886751355, -0.006172837907, 0), (-0.285111245, -0.004115224758, 0)), Line((0, -0.1728395062, 0), (0.003563890562, -0.170781893, 0)), Line((0.2886751354, -0.006172838068, 0), (0.292239026, -0.004115224919, 0)), Line((0.2886751355, 0.3271604922, 0), (0.2922390261, 0.3292181054, 0))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]))  # disabled

brep_centroid_2 = BrepCentroid(Brep=fast_loop_start_8.Data)  # disabled
trim_tree = TrimTree(Tree=brep_centroid_2, Depth=1)  # disabled

merge_20 = Merge(Data1=deconstruct_arc_6.BasePlane, Data2=cull_index_4)  # disabled
polar_array_5 = PolarArray(Geometry=scale_37.Geometry, Plane=PlaneXY(0, 0, 0), Count=6, Angle=6.283185307)  # -> Geometry, Transform; disabled
scale_38 = Scale(Geometry=list_item_4, Center=flatten(merge_20), Factor=0.3333333333)  # -> Geometry, Transform; disabled
power = Power(A="3", B=series)  # disabled
cull_index_6 = CullIndex(List=fast_loop_end_7, Indices=0, Wrap=True)  # disabled
digit_scroller_11 = DigitScroller(Scroller_Digits=12, Scroller_Prefix="Digit Scroller", Scroller_Radix=1, Scroller_Value=1.732050808)  # disabled
cull_index_7 = CullIndex(List=subdivide_triangle_2.TriangleCellsB, Indices=6, Wrap=True)
scale_39 = Scale(Geometry=subdivide_triangle_2.TriangleCellsB, Center=area.Centroid, Factor=0.3333333333)  # -> Geometry, Transform
face_boundaries_6 = FaceBoundaries(Mesh=weaverbird_s_split_triangles_subdivision_6)
digit_scroller_12 = DigitScroller(Scroller_Digits=12, Scroller_Prefix="Digit Scroller", Scroller_Radix=11, Scroller_Value=6)  # disabled
rotate_4 = Rotate(Geometry=face_boundaries_5, Angle=degrees(30), Plane=PlaneXY(0, 0, 0))  # -> Geometry, Transform
merge_21 = Merge(Data1=divide_curve_2.Points)  # disabled
rotate_5 = Rotate(Geometry=polar_array_5.Geometry, Angle=degrees(30), Plane=PlaneXY(0, 0, 0))  # -> Geometry, Transform; disabled
fast_loop_start_9 = FastLoopStart(Iterations=3, Data=rotate_5.Geometry)  # -> port, Counter, Data; disabled
mirror_curve_2 = MirrorCurve(Geometry=flatten(merge_19), Curve=graft(explode_2.Segments), Tangent=True)
cull_index_8 = CullIndex(List=polar_array_4.Geometry, Indices=[2, 4], Wrap=False)  # disabled
boundary_surfaces_11 = BoundarySurfaces(Edges=[mirror_curve_2, merge_19])
scale_40 = Scale(Geometry=graft(fast_loop_start_8.Data), Center=flatten(Point(0, 0, 0)), Factor=0.3333333333)  # -> Geometry, Transform; disabled
boundary_surfaces_12 = BoundarySurfaces(Edges=face_boundaries_6)
power_2 = Power(A="3", B=digit_scroller_12)  # disabled
scale_41 = Scale(Center=Point(0, 0, 0), Factor=-0.5)  # -> Geometry, Transform; disabled
range = Range(Domain=Domain(0, 1), Steps=256)  # disabled
range_2 = Range(Domain=Domain(0, 1), Steps=256)  # disabled
scale_42 = Scale(Geometry=graft(fast_loop_start_9.Data), Center=flatten(Point(0, 0, 0)), Factor=0.3333333333)  # -> Geometry, Transform; disabled
expression_8 = Expression(X=range_2, Expression="X")  # disabled
pi = Pi(Factor=digit_scroller_11)  # disabled
expression_9 = Expression(X=range, A=pi, M=power, Expression="SIN(X*PI*M)/(SQRT(3)*PI)/M")  # disabled
circle_3 = Circle(Plane=PlaneXY(0, 0, 0), Radius=1)  # disabled
list_item_6 = ListItem(List=cull_index_8, Index=0, Wrap=True)  # disabled
brep_centroid_3 = BrepCentroid(Brep=scale_40.Geometry)  # disabled
cull_index_9 = CullIndex(List=scale_38.Geometry, Indices=[2, 4], Wrap=False)  # disabled
list_item_7 = ListItem(List=flatten(scale_38.Geometry), Index=0, Wrap=True)  # disabled
divide_curve_14 = DivideCurve(Curve=list_item_6, Count=2, Kinks=False)  # -> Points, Tangents, Parameters; disabled
construct_point_4 = ConstructPoint(XCoordinate=range, YCoordinate=expr("-X", expression_9), ZCoordinate=0)  # disabled
construct_point_5 = ConstructPoint(XCoordinate=range, YCoordinate=expression_9, ZCoordinate=0)  # disabled
construct_point_6 = ConstructPoint(XCoordinate=range_2, YCoordinate=0, ZCoordinate=0)  # disabled
deconstruct_arc_7 = DeconstructArc(Arc=list_item_6)  # -> BasePlane, Radius, Angle; disabled
fast_loop_end_8 = FastLoopEnd(
    port=fast_loop_start_8.port,
    Exit=False,
    Data=scale_40.Geometry,
    Data_2=brep_centroid_2,
    Data_3=brep_centroid_3,
    RecordData=True,
    TimeOutVal=0)  # -> Data, D1, D2; disabled
fast_loop_end_9 = FastLoopEnd(port=fast_loop_start_9.port, Exit=False, Data=scale_42.Geometry, RecordData=True, TimeOutVal=0)  # disabled
merge_22 = Merge(Data1=rotate_5.Geometry, Data2=fast_loop_end_9)  # -> flatten(Result); disabled
divide_curve_15 = DivideCurve(Curve=list_item_7, Count=6, Kinks=False)  # -> Points, Tangents, Parameters; disabled
interpolate = Interpolate(Vertices=construct_point_5, Degree=3, Periodic=False, KnotStyle=1)  # -> Curve, Length, Domain; disabled
deconstruct_arc_8 = DeconstructArc(Arc=list_item_7)  # -> BasePlane, Radius, Angle; disabled
interpolate_2 = Interpolate(Vertices=construct_point_4, Degree=3, Periodic=False, KnotStyle=1)  # -> Curve, Length, Domain; disabled
list_item_8 = ListItem(List=cull_index_9, Index=1, Wrap=True)  # disabled
merge_23 = Merge(Data1=deconstruct_arc_7.BasePlane, Data2=divide_curve_14.Points)  # disabled
line_4 = Line(StartPoint=fast_loop_end_8.D1, EndPoint=fast_loop_end_8.D2)  # disabled
cull_index_10 = CullIndex(List=divide_curve_15.Points, Indices=[2, 4], Wrap=False)  # disabled
divide_curve_16 = DivideCurve(Curve=list_item_8, Count=2, Kinks=False)  # -> Points, Tangents, Parameters; disabled
point_9 = Point(merge_23)  # disabled
merge_24 = Merge(Data1=interpolate.Curve, Data2=interpolate_2.Curve)  # disabled
deconstruct_arc_9 = DeconstructArc(Arc=list_item_8)  # -> BasePlane, Radius, Angle; disabled
scale_43 = Scale(Geometry=list_item_6, Center=flatten(point_9), Factor=0.3333333333)  # -> Geometry, Transform; disabled
stroke = Stroke(ShapeGeometry=merge_22, Color=RGBA(0, 244, 124, 0), Weight=0, EndCap=0)  # disabled
merge_25 = Merge(Data1=deconstruct_arc_8.BasePlane, Data2=cull_index_10)  # disabled
scale_44 = Scale(Geometry=list_item_7, Center=flatten(merge_25), Factor=0.3333333333)  # -> Geometry, Transform; disabled
polar_array_6 = PolarArray(Geometry=merge_24, Plane=PlaneXY(0, 0, 0), Count=6, Angle=6.283185307)  # -> Geometry, Transform; disabled
rotate_6 = Rotate(Geometry=polar_array_6.Geometry, Angle=degrees(90), Plane=PlaneXY(0, 0, 0))  # -> Geometry, Transform; disabled
scale_45 = Scale(Geometry=rotate_6.Geometry, Center=Point(0, 0, 0), Factor=0.1666666667)  # -> Geometry, Transform; disabled
center = Center(Geometry=scale_45.Geometry)  # -> Center, Dimension; disabled
fast_loop_start_10 = FastLoopStart(Iterations=digit_scroller_8, Data=scale_45.Geometry, D1=scale_45.Geometry, D2=center.Center)  # -> port, Counter, Data, Data_2, Data_3, Data_4; disabled
center_2 = Center(Geometry=fast_loop_start_10.Data, forall=False)  # -> Center, Dimension; disabled
trim_tree_2 = TrimTree(Tree=center_2.Center, Depth=fast_loop_start_10.Counter)  # disabled
scale_46 = Scale(Geometry=graft(fast_loop_start_10.Data), Center=flatten(merge_7), Factor=0.3333333333)  # -> Geometry, Transform; disabled
merge_26 = Merge(Data1=fast_loop_start_10.Data_2, Data2=scale_46.Geometry)  # disabled
center_3 = Center(Geometry=scale_46.Geometry, forall=False)  # -> Center, Dimension; disabled
fast_loop_end_10 = FastLoopEnd(
    port=fast_loop_start_10.port,
    Exit=False,
    Data=scale_46.Geometry,
    Data_2=merge_26,
    Data_3=center_2.Center,
    Data_4=center_3.Center,
    RecordData=True,
    TimeOutVal=0)  # -> Data, D1, D2, D3; disabled
stream_filter_3 = StreamFilter(Gate=number_slider_3, Stream0=fast_loop_end_10.Data, Stream1=fast_loop_end_10.D1)  # disabled
trim_tree_3 = TrimTree(Tree=center_3.Center, Depth=expr("X+1", fast_loop_start_10.Counter))  # disabled
geometry_4 = Geometry(stream_filter_3)  # disabled
stroke_2 = Stroke(ShapeGeometry=geometry_4, Color=RGBA(0, 244, 124, 0), Weight=0, EndCap=0)  # disabled
scale_47 = Scale(Geometry=fast_loop_end_10.Data, Center=Point(0, 0, 0), Factor=0.3333333333)  # -> Geometry, Transform; disabled
custom_preview_3 = CustomPreview(
    Geometry=geometry_4,
    Material={diffuse=RGB(221, 160, 221), emission=RGB(66, 48, 66), shine=0.5, specular=RGB(255, 255, 255), transparency=0})  # disabled
fast_loop_start_11 = FastLoopStart(Iterations=digit_scroller_10, Data=geometry_4)  # -> port, Counter, Data; disabled
line_5 = Line(StartPoint=fast_loop_end_10.D2, EndPoint=fast_loop_end_10.D3)  # disabled
scale_48 = Scale(Geometry=graft(fast_loop_start_11.Data), Center=flatten(Point(0, 0, 0)), Factor=0.3333333333)  # -> Geometry, Transform; disabled
center_4 = Center(Geometry=fast_loop_start_10.Data, forall=False)  # -> Center, Dimension; disabled
solid_fill = SolidFill(ShapeGeometry=stroke_2, Color=RGB(0, 244, 124))  # disabled
shape_data = ShapeData(ShapeGeometry=solid_fill, ID=" ", Hover=False)  # disabled
scale_49 = Scale(Geometry=graft(fast_loop_start_10.Data), Center=flatten(merge_7), Factor=0.3333333333)  # -> Geometry, Transform; disabled
construct_drawing = ConstructDrawing(
    ShapesGeometry=flatten(shape_data),
    Boundary=bounding_rectangle,
    Width=power_2,
    Height=power_2,
    Color=RGBA(255, 255, 255, 0))  # -> Drawing, Boundary; disabled
drawing_viewer = DrawingViewer(DrawingsShapesGeometry=construct_drawing.Drawing, Resolution=96)  # disabled
save_svg = SaveSvg(DrawingsShapesGeometry=flatten(construct_drawing.Drawing), FolderPath="C:\", FileName="ϱvƨ", Save=button_2)  # disabled
fast_loop_end_11 = FastLoopEnd(port=fast_loop_start_11.port, Exit=False, Data=scale_48.Geometry, RecordData=True, TimeOutVal=0)  # disabled
center_5 = Center(Geometry=scale_49.Geometry, forall=False)  # -> Center, Dimension; disabled
line_6 = Line(StartPoint=center_4.Center, EndPoint=center_5.Center)  # disabled
scale_50 = Scale(Geometry=graft(scale_49.Geometry), Center=flatten(merge_7), Factor=0.3333333333)  # -> Geometry, Transform; disabled
polyline = PolyLine(Vertices=center_5.Center, Closed=True)  # disabled
center_6 = Center(Geometry=scale_50.Geometry, forall=False)  # -> Center, Dimension; disabled
line_7 = Line(StartPoint=center_5.Center, EndPoint=center_6.Center)  # disabled
trim_tree_4 = TrimTree(Tree=center_6.Center, Depth=1)  # disabled
scale_51 = Scale(Geometry=graft(scale_50.Geometry), Center=flatten(merge_7), Factor=0.3333333333)  # -> Geometry, Transform; disabled
merge_27 = Merge(Data1=deconstruct_arc_9.BasePlane, Data2=divide_curve_16.Points)  # disabled
polyline_2 = PolyLine(Vertices=center_6.Center, Closed=True)  # disabled
solid_fill_2 = SolidFill(ShapeGeometry=stroke, Color=RGB(0, 244, 124))  # disabled
shape_data_2 = ShapeData(ShapeGeometry=solid_fill_2, ID=" ", Hover=False)  # disabled
point_10 = Point(merge_27)  # disabled
scale_52 = Scale(Geometry=list_item_8, Center=flatten(point_10), Factor=0.3333333333)  # -> Geometry, Transform; disabled
end_points = EndPoints(Curve=polar_array_6.Geometry)  # -> Start, End; disabled
scale_53 = Scale(Geometry=polar_array_6.Geometry, Center=end_points.End, Factor=1)  # -> Geometry, Transform; disabled
multiple_curves = MultipleCurves(Curves=flatten(scale_53.Geometry))  # -> Points, IndexA, IndexB, ParamA, ParamB; disabled
collision_many_many = CollisionManyMany(Colliders=flatten(scale_53.Geometry))  # -> Collision, Indices; disabled
center_7 = Center(Geometry=scale_51.Geometry, forall=False)  # -> Center, Dimension; disabled
trim_tree_5 = TrimTree(Tree=center_7.Center, Depth=1)  # disabled
line_8 = Line(StartPoint=trim_tree_4, EndPoint=trim_tree_5)  # disabled
trim_tree_6 = TrimTree(Tree=trim_tree_5, Depth=1)  # disabled
power_3 = Power(A="3", B=digit_scroller_12)  # disabled
construct_drawing_2 = ConstructDrawing(
    ShapesGeometry=flatten(shape_data_2),
    Boundary=bounding_rectangle,
    Width=power_3,
    Height=power_3,
    Color=RGBA(255, 255, 255, 0))  # -> Drawing, Boundary; disabled
drawing_viewer_2 = DrawingViewer(DrawingsShapesGeometry=construct_drawing_2.Drawing, Resolution=96)  # disabled
save_svg_2 = SaveSvg(DrawingsShapesGeometry=flatten(construct_drawing_2.Drawing), FolderPath="C:\", FileName="ϱvƨ", Save=button)  # disabled
polar_array_7 = PolarArray(Geometry=scale_43.Geometry, Plane=PlaneXY(0, 0, 0), Count=6, Angle=6.283185307)  # -> Geometry, Transform; disabled
polar_array_8 = PolarArray(Geometry=scale_52.Geometry, Plane=PlaneXY(0, 0, 0), Count=6, Angle=6.283185307)  # -> Geometry, Transform; disabled
polyline_3 = PolyLine(Vertices=center_7.Center, Closed=True)  # disabled
geometry_5 = Geometry(polyline_3)  # disabled
merge_28 = Merge(Data1=line_6, Data2=line_7, Data3=line_8, Data5=geometry_5)  # disabled
ggcurvessplitintersect = GgCurvesSplitIntersect(Curves=flatten(merge_28), Tol=7.629394531e-06, SplitPoly=True)  # -> flatten(Curves); disabled
multipipe = MultiPipe(
    Curves=flatten(ggcurvessplitintersect),
    NodeSize=0.0004572477,
    EndOffset=0,
    StrutSize=1,
    Segment=0,
    KinkAngle=0,
    CubeFit=0,
    Caps=1)  # disabled
custom_preview_4 = CustomPreview(
    Geometry=multipipe,
    Material={diffuse=RGB(176, 176, 176), emission=RGB(53, 53, 53), shine=0.5, specular=RGB(255, 255, 255), transparency=0})  # disabled
curve_direction = CurveDirection(Curve=merge_28)  # disabled
scale_54 = Scale(Geometry=graft(scale_51.Geometry), Center=flatten(merge_7), Factor=0.3333333333)  # -> Geometry, Transform; disabled
center_8 = Center(Geometry=scale_54.Geometry, forall=False)  # -> Center, Dimension; disabled
trim_tree_7 = TrimTree(Tree=center_8.Center, Depth=1)  # disabled
trim_tree_8 = TrimTree(Tree=trim_tree_7, Depth=1)  # disabled
line_9 = Line(StartPoint=trim_tree_6, EndPoint=trim_tree_8)  # disabled
trim_tree_9 = TrimTree(Tree=trim_tree_8, Depth=1)  # disabled
cull_index_11 = CullIndex(List=polar_array_7.Geometry, Indices=[2, 4], Wrap=False)  # disabled
cull_index_12 = CullIndex(List=polar_array_8.Geometry, Indices=[2, 4], Wrap=False)  # disabled
polyline_4 = PolyLine(Vertices=center_8.Center, Closed=True)  # disabled
scale_55 = Scale(Geometry=graft(scale_54.Geometry), Center=flatten(merge_7), Factor=0.3333333333)  # -> Geometry, Transform; disabled
center_9 = Center(Geometry=scale_55.Geometry, forall=False)  # -> Center, Dimension; disabled
trim_tree_10 = TrimTree(Tree=center_9.Center, Depth=1)  # disabled
trim_tree_11 = TrimTree(Tree=trim_tree_10, Depth=1)  # disabled
trim_tree_12 = TrimTree(Tree=trim_tree_11, Depth=1)  # disabled
line_10 = Line(StartPoint=trim_tree_9, EndPoint=trim_tree_12)  # disabled
trim_tree_13 = TrimTree(Tree=trim_tree_12, Depth=1)  # disabled
scale_56 = Scale(Geometry=graft(scale_55.Geometry), Center=flatten(merge_7), Factor=0.3333333333)  # -> Geometry, Transform; disabled
center_10 = Center(Geometry=scale_56.Geometry, forall=False)  # -> Center, Dimension; disabled
trim_tree_14 = TrimTree(Tree=center_10.Center, Depth=1)  # disabled
trim_tree_15 = TrimTree(Tree=trim_tree_14, Depth=1)  # disabled
trim_tree_16 = TrimTree(Tree=trim_tree_15, Depth=1)  # disabled
trim_tree_17 = TrimTree(Tree=trim_tree_16, Depth=1)  # disabled
line_11 = Line(StartPoint=trim_tree_13, EndPoint=trim_tree_17)  # disabled
