# Grasshopper definition XHꓨ..XHꓨ..XHꓨ.. ⊚◦୦◦◯◦୦◦⬢◦୦◦◯◦୦◦⊚ ⊚◦୦◦◯◦୦◦⬢◦୦◦◯◦୦◦⊚ ..GHX..GHX..GHX (Grasshopper 1.0.7)
# plug-ins: Anemone, GraphicPlus, BlueOrange, Graphic Statics 3D, Heteroptera, Kangaroo2 Components, BullAnt, Flexibility.Gh-by Ehsan, BubalusGH2.0, CurvePlus, Pufferfish, Weaverbird, LunchBox, GhPython Script, Bulge, Pancake, HortaMethodBased

number_slider = Slider(2, range=-1..3)
number_slider_2 = Slider(1, range=0..1)
number_slider_3 = Slider(0, range=0..1)
number_slider_4 = Slider(1, range=0..1)
stream_filter = StreamFilter(Gate=number_slider_3, Stream0="3^-1", Stream1="3^-2")
stream_filter_2 = StreamFilter(Gate=number_slider_3, Stream0="3", Stream1="2.25")
power = Power(A="3", B="-1")

number_slider_5 = Slider(0, range=0..1)
number_slider_6 = Slider(0, range=0..1)

addition = Addition(A=number_slider, B="1")
digit_scroller = DigitScroller(Scroller_Digits=12, Scroller_Prefix="Digit Scroller", Scroller_Radix=1, Scroller_Value=0.12830002)  # disabled
triangular = Triangular(Plane=PlaneXY(-0.6735753001, -0.3888888746, 0), Size=digit_scroller, ExtentX=21, ExtentY=1)  # -> Cells, Points; disabled
division = Division(A="-1", B="9")
point = Point(Point(0, 0, 0))
multiplication = Multiplication(A=division, B="2/SQRT(3)")
vector_xyz = VectorXYZ(XComponent=0, YComponent=multiplication, ZComponent=0)  # -> Vector, Length
digit_scroller_2 = DigitScroller(Scroller_Digits=12, Scroller_Prefix="Digit Scroller", Scroller_Radix=1, Scroller_Value=0.05555555555)  # disabled
multiplication_2 = Multiplication(A=".5", B="2/SQRT(3)")
construct_point = ConstructPoint(XCoordinate=0, YCoordinate=multiplication_2, ZCoordinate=0)
digit_scroller_3 = DigitScroller(Scroller_Digits=12, Scroller_Prefix="Digit Scroller", Scroller_Radix=1, Scroller_Value=0.384900179)  # disabled
expression = Expression(Expression="2/(3*sqrt(3))/3/2")  # disabled
expression_2 = Expression(Expression="2/(3*sqrt(3))/3/2/3")  # disabled
negative = Negative(Value=expression)  # disabled
negative_2 = Negative(Value=expression_2)  # disabled
merge = Merge(Data1=negative, Data2=expression)  # -> graft(Result); disabled
merge_2 = Merge(Data1=negative_2, Data2=expression_2)  # -> graft(Result); disabled
multiplication_3 = Multiplication(A="36", B="1")
multiplication_4 = Multiplication(A="36", B="32")
multiplication_5 = Multiplication(A="36", B="4")
subtraction = Subtraction(A=number_slider, B="2")
multiplication_6 = Multiplication(A="36", B="38")
multiplication_7 = Multiplication(A="36", B="2")
subtraction_2 = Subtraction(A=number_slider, B="3")
multiplication_8 = Multiplication(A="36", B="34")
multiplication_9 = Multiplication(A="36", B="16")
multiplication_10 = Multiplication(A="36", B="5")
multiplication_11 = Multiplication(A="36", B="40")
multiplication_12 = Multiplication(A="36", B=14)
multiplication_13 = Multiplication(A="36", B="20")
subtraction_3 = Subtraction(A=number_slider, B=1)
subtraction_4 = Subtraction(A=number_slider, B="3")
multiplication_14 = Multiplication(A="36", B="11")
multiplication_15 = Multiplication(A="36", B="13")
multiplication_16 = Multiplication(A="36", B="7")
multiplication_17 = Multiplication(A="36", B="22")
subtraction_5 = Subtraction(A=number_slider, B="3")
subtraction_6 = Subtraction(A=number_slider, B="2")
subtraction_7 = Subtraction(A=number_slider, B="3")
subtraction_8 = Subtraction(A=number_slider, B=1)
subtraction_9 = Subtraction(A=number_slider, B="2")
subtraction_10 = Subtraction(A=number_slider, B="3")
subtraction_11 = Subtraction(A=number_slider, B="3")
subtraction_12 = Subtraction(A=number_slider, B="2")
indices = Indices([2, 5, 7])
subtraction_13 = Subtraction(A=number_slider, B="3")
subtraction_14 = Subtraction(A=number_slider, B="3")
true_only_button = TrueOnlyButton(LastSaveLocalization="neutral,N")
number_slider_7 = Slider(1, range=0..1)  # disabled
number_slider_8 = Slider(0, range=0..1)  # disabled
division_2 = Division(A="1", B="9")
division_3 = Division(A="1", B="27")
division_4 = Division(A="809", B="2187")
construct_point_2 = ConstructPoint(XCoordinate=0, YCoordinate=expr("-X", division_4), ZCoordinate=0)
construct_point_3 = ConstructPoint(XCoordinate=0, YCoordinate=division_4, ZCoordinate=0)
division_5 = Division(A="1", B="3")
construct_domain = ConstructDomain(DomainStart=270, DomainEnd=330)  # disabled
point_2 = Point(Point(0, 0, 0))  # disabled
division_6 = Division(A="1", B="27")
plane = Plane(PlaneXY(0, 0, 0))
rotate = Rotate(Geometry=plane, Angle=-1.570796327, Plane=PlaneXY(0, 0, 0))  # -> Geometry, Transform
sierpinski_fractal = SierpinskiFractal(Radius=8, Side=6, N=3, Deform=1)  # disabled
rectangle_2pt = Rectangle2Pt(Plane=PlaneXY(0, 0, 0), PointA=Point(0.5, 0.5, 0), PointB=Point(-0.5, -0.5, 0), Radius=0)  # -> Rectangle, Length; disabled
polygon = Polygon(Plane=PlaneXY(0, 0, 0), Radius=0.5, Segments=6, FilletRadius=0, Polygon=True)  # -> Polygon, Length; disabled
division_7 = Division(A="1", B="27")
division_8 = Division(A="1", B="27")
division_9 = Division(A="1", B="9")
division_10 = Division(A=number_slider_7, B=2)  # disabled
circle = Circle(Plane=PlaneXY(0, 0, 0), Radius=division_10)  # disabled
geometry = Geometry(circle)  # disabled
scale = Scale(Geometry=geometry, Center=Point(0, 0, 0), Factor=0.3333333333)  # -> Geometry, Transform; disabled
divide_curve = DivideCurve(Curve=geometry, Count=2, Kinks=False)  # -> Points, Tangents, Parameters; disabled
divide_curve_2 = DivideCurve(Curve=geometry, Count=2, Kinks=False)  # -> Points, Tangents, Parameters; disabled
deconstruct_arc = DeconstructArc(Arc=geometry)  # -> BasePlane, Radius, Angle; disabled
polygon_2 = Polygon(Plane=PlaneXY(0, 0, 0), Radius=division_10, Segments=6, FilletRadius=0)  # -> Polygon, Length; disabled
point_3 = Point(deconstruct_arc.BasePlane)  # disabled
division_11 = Division(A="1", B="3")
boundary_surfaces = BoundarySurfaces(Edges=rectangle_2pt.Rectangle)  # disabled
point_4 = Point(Point(0, 0, 0))  # disabled
division_12 = Division(A="1", B="9")
fast_loop_start = FastLoopStart(Iterations=3, Data=geometry)  # -> port, Counter, Data; disabled
division_13 = Division(A="1", B="27")
point_5 = Point(Point(0, 0, 0))  # disabled
stream_filter_3 = StreamFilter(Gate=number_slider_8, Stream0=circle, Stream1=polygon_2.Polygon)  # disabled
line = Line(StartPoint=construct_point_3, EndPoint=construct_point_2)
digit_scroller_4 = DigitScroller(Scroller_Digits=12, Scroller_Prefix="Digit Scroller", Scroller_Radix=1, Scroller_Value=-0.1111111111)  # disabled
merge_3 = Merge(Data1=point_3, Data2=divide_curve.Points)  # -> flatten(Result); disabled
division_14 = Division(A=Slider(1, range=0..1), B=2)
circumscribed_polygon = CircumscribedPolygon(Plane=rotate.Geometry, Radius=division_14, Sides=3)
scale_2 = Scale(Geometry=circumscribed_polygon, Center=Point(0, 0, 0), Factor=0.6666666667)  # -> Geometry, Transform; disabled
divide_curve_3 = DivideCurve(Curve=scale_2.Geometry, Count=54, Kinks=False)  # -> Points, Tangents, Parameters; disabled
scale_3 = Scale(Geometry=circumscribed_polygon, Center=Point(0, 0, 0), Factor=0.3333333333)  # -> Geometry, Transform; disabled
scale_4 = Scale(Geometry=scale_2.Geometry, Center=Point(0, 0, 0), Factor=digit_scroller_2)  # -> Geometry, Transform; disabled
orient = Orient(Geometry=scale_4.Geometry, Source=PlaneXY(0, 0, 0), Target=divide_curve_3.Points)  # -> Geometry, Transform; disabled
boundary_surfaces_2 = BoundarySurfaces(Edges=orient.Geometry)  # disabled
scale_5 = Scale(Geometry=circumscribed_polygon, Center=Point(0, 0, 0), Factor=0.8888888889)  # -> Geometry, Transform; disabled
scale_6 = Scale(Geometry=circumscribed_polygon, Center=Point(0, 0, 0), Factor=0.4444444444)  # -> Geometry, Transform; disabled
divide_curve_4 = DivideCurve(Curve=scale_5.Geometry, Count=162, Kinks=False)  # -> Points, Tangents, Parameters; disabled
scale_7 = Scale(Geometry=scale_2.Geometry, Center=Point(0, 0, 0), Factor=0.0185185185)  # -> Geometry, Transform; disabled
orient_2 = Orient(Geometry=scale_7.Geometry, Source=PlaneXY(0, 0, 0), Target=divide_curve_4.Points)  # -> Geometry, Transform; disabled
boundary_surfaces_3 = BoundarySurfaces(Edges=orient_2.Geometry)  # disabled
divide_curve_5 = DivideCurve(Curve=scale_6.Geometry, Count=108, Kinks=False)  # -> Points, Tangents, Parameters; disabled
weaverbird_s_sierpinski_carpet = WeaverbirdsSierpinskiCarpet(MeshPolylines=circumscribed_polygon, Distance=expr("2/(3*sqrt(3))", 0.384900179), InsetType=1)  # disabled
scale_8 = Scale(Geometry=scale_2.Geometry, Center=Point(0, 0, 0), Factor=0.0185185185)  # -> Geometry, Transform; disabled
orient_3 = Orient(Geometry=scale_8.Geometry, Source=PlaneXY(0, 0, 0), Target=divide_curve_5.Points)  # -> Geometry, Transform; disabled
boundary_surfaces_4 = BoundarySurfaces(Edges=orient_3.Geometry)  # disabled
weaverbird_s_sierpinski_carpet_2 = WeaverbirdsSierpinskiCarpet(MeshPolylines=scale_2.Geometry, Distance=graft([-5.555555556, 5.555555556]), InsetType=0)  # disabled
face_boundaries = FaceBoundaries(Mesh=weaverbird_s_sierpinski_carpet)  # disabled
weaverbird_s_sierpinski_carpet_3 = WeaverbirdsSierpinskiCarpet(MeshPolylines=scale_2.Geometry, Distance=merge, InsetType=1)  # disabled
weaverbird_s_sierpinski_carpet_4 = WeaverbirdsSierpinskiCarpet(MeshPolylines=scale_2.Geometry, Distance=merge_2, InsetType=1)  # disabled
weaverbird_s_split_triangles_subdivision = WeaverbirdsSplitTrianglesSubdivision(MeshCurves=circumscribed_polygon, Level=3)
discontinuity = Discontinuity(Curve=circumscribed_polygon, Level=1)  # -> Points, Parameters
circle_2 = Circle(Plane=rotate.Geometry, Radius=division_14)
scale_9 = Scale(Geometry=circle_2, Center=Point(0, 0, 0), Factor=0.3333333333)  # -> Geometry, Transform
scale_10 = Scale(Geometry=scale_9.Geometry, Center=Point(0, 0, 0), Factor=1)  # -> Geometry, Transform
scale_11 = Scale(Geometry=scale_9.Geometry, Center=Point(0, 0, 0), Factor=0.3333333333)  # -> Geometry, Transform
rotate_2 = Rotate(Geometry=scale_9.Geometry, Angle=1.570796327, Plane=PlaneXY(0, 0, 0))  # -> Geometry, Transform
divide_curve_6 = DivideCurve(Curve=rotate_2.Geometry, Count=2, Kinks=False)  # -> Points, Tangents, Parameters
scale_12 = Scale(Geometry=circle_2, Center=Point(0, 0, 0), Factor="2/SQRT(3)")  # -> Geometry, Transform
rotate_3 = Rotate(Geometry=circle_2, Angle=1.570796327, Plane=PlaneXY(0, 0, 0))  # -> Geometry, Transform
divide_curve_7 = DivideCurve(Curve=rotate_3.Geometry, Count=2, Kinks=False)  # -> Points, Tangents, Parameters
merge_4 = Merge(Data1=divide_curve_2.Points, Data2=point_2)  # disabled
division_15 = Division(A="1", B="27")
division_16 = Division(A=".5", B="9")
expression_3 = Expression(Expression="1/SQRT(3)")  # disabled
expression_4 = Expression(Expression=".5/3")  # disabled
fast_loop_start_2 = FastLoopStart(Iterations=4, Data=scale_11.Geometry)  # -> port, Counter, Data
expression_5 = Expression(Expression="1/2/SQRT(3)")  # disabled
expression_6 = Expression(Expression="1/3")  # disabled
fast_loop_start_3 = FastLoopStart(Iterations=4, Data=scale_9.Geometry)  # -> port, Counter, Data
rotate_4 = Rotate(Geometry=stream_filter_3, Angle=degrees(90), Plane=PlaneXY(0, 0, 0))  # -> Geometry, Transform; disabled
scale_13 = Scale(Geometry=divide_curve_6.Points, Center=Point(0, 0, 0), Factor=1)  # -> Geometry, Transform
scale_14 = Scale(Geometry=scale_10.Geometry, Center=scale_13.Geometry, Factor=0.3333333333)  # -> Geometry, Transform
panel = Panel("2/SQRT(3)")  # disabled
scale_15 = Scale(Geometry=boundary_surfaces, Center=Point(0, 0, 0), Factor=0.3333333333)  # -> Geometry, Transform; disabled
triangular_2 = Triangular(Plane=PlaneXY(0, 0, 0), Size=1, ExtentX=3, ExtentY=2)  # -> Cells, Points; disabled
line_2 = Line(line)
explode = Explode(Curve=polygon.Polygon, Recursive=True)  # -> Segments, Vertices; disabled
divide_curve_8 = DivideCurve(Curve=rectangle_2pt.Rectangle, Count=8, Kinks=False)  # -> Points, Tangents, Parameters; disabled
boundary_surfaces_5 = BoundarySurfaces(Edges=rotate_4.Geometry)  # disabled
scale_16 = Scale(Geometry=boundary_surfaces_5, Center=Point(0, 0, 0), Factor=0.3333333333)  # -> Geometry, Transform; disabled
curve_middle = CurveMiddle(Curve=explode.Segments)  # disabled
merge_5 = Merge(Data2=curve_middle)  # -> flatten(Result); disabled
polar_array = PolarArray(Geometry=line_2, Plane=PlaneXY(0, 0, 0), Count=3, Angle=6.283185307)  # -> flatten(Geometry), Transform
curve_display = CurveDisplay(Curves=polar_array.Geometry)
scale_17 = Scale(Geometry=graft(fast_loop_start.Data), Center=flatten(merge_3), Factor=0.3333333333)  # -> Geometry, Transform; disabled
digit_scroller_5 = DigitScroller(Scroller_Digits=12, Scroller_Prefix=" ", Scroller_Radix=11, Scroller_Value=3)  # disabled
fast_loop_start_4 = FastLoopStart(Iterations=digit_scroller_5, Data=scale.Geometry)  # -> port, Counter, Data; disabled
geometry_2 = Geometry(scale_12.Geometry)
scale_18 = Scale(Geometry=graft(fast_loop_start_4.Data), Center=flatten(merge_4), Factor=0.3333333333)  # -> Geometry, Transform; disabled
pipe = Pipe(Curve=line_2, Radius=division_16, Caps=2)  # disabled
rotate_5 = Rotate(Geometry=circle, Angle=degrees(90), Plane=PlaneXY(0, 0, 0))  # -> Geometry, Transform; disabled
divide_curve_9 = DivideCurve(Curve=rotate_5.Geometry, Count=6, Kinks=False)  # -> Points, Tangents, Parameters; disabled
cull_index = CullIndex(List=divide_curve_9.Points, Indices=[2, 4], Wrap=False)  # disabled
merge_6 = Merge(Data1=point_4, Data2=cull_index)  # -> flatten(Result); disabled
list_item = ListItem(List=divide_curve_9.Points, Index=3, Wrap=True)  # disabled
digit_scroller_6 = DigitScroller(Scroller_Digits=12, Scroller_Prefix="Digit Scroller", Scroller_Radix=11, Scroller_Value=2)  # disabled
division_17 = Division(A="-1", B="27")
division_18 = Division(A="1", B="9")
scale_19 = Scale(Geometry=graft(fast_loop_start_2.Data), Center=divide_curve_7.Points, Factor=0.3333333333)  # -> Geometry, Transform
divide_curve_10 = DivideCurve(Curve=rotate_4.Geometry, Count=6, Kinks=False)  # -> Points, Tangents, Parameters; disabled
multiplication_18 = Multiplication(A=division_17, B="2/SQRT(3)")
scale_20 = Scale(Geometry=graft(fast_loop_start_3.Data), Center=divide_curve_7.Points, Factor=0.3333333333)  # -> Geometry, Transform
division_19 = Division(A="1", B="27")
multiplication_19 = Multiplication(A=digit_scroller_4, B=panel)  # disabled
scale_21 = Scale(Geometry=graft(polygon.Polygon), Center=merge_5, Factor=0.3333333333)  # -> Geometry, Transform; disabled
point_6 = Point(Point(0, 0, 0))  # disabled
vector_xyz_2 = VectorXYZ(XComponent=0, YComponent=multiplication_19, ZComponent=0)  # -> Vector, Length; disabled
button = Button()  # disabled
construct_point_4 = ConstructPoint(XCoordinate=expression_6, YCoordinate=0, ZCoordinate=0)  # disabled
construct_point_5 = ConstructPoint(XCoordinate=0, YCoordinate=expression_5, ZCoordinate=0)  # disabled
scale_22 = Scale(Geometry=circle_2, Center=discontinuity.Points, Factor=0.3333333333)  # -> Geometry, Transform
scale_23 = Scale(Geometry=rotate_5.Geometry, Center=graft(merge_6), Factor=0.3333333333)  # -> flatten(Geometry), Transform; disabled
vector_xyz_3 = VectorXYZ(XComponent=0, YComponent=multiplication_18, ZComponent=0)  # -> Vector, Length
division_20 = Division(A="1", B="27")
digit_scroller_7 = DigitScroller(Scroller_Digits=12, Scroller_Prefix="Digit Scroller", Scroller_Radix=11, Scroller_Value=1)  # disabled
cull_pattern = CullPattern(CullPattern=[False, False, True, True])
fast_loop_start_5 = FastLoopStart(Iterations=digit_scroller_7, Data=scale_15.Geometry)  # -> port, Counter, Data; disabled
digit_scroller_8 = DigitScroller(Scroller_Digits=12, Scroller_Prefix="Digit Scroller", Scroller_Radix=11, Scroller_Value=2)  # disabled
circumscribed_polygon_2 = CircumscribedPolygon(Plane=PlaneXY(0, 0, 0), Radius=0.5, Sides=6)
geometry_3 = Geometry(circumscribed_polygon_2)
area = Area(Geometry=geometry_3)  # -> Area, Centroid

rotate_6 = Rotate(Geometry=geometry_3, Angle=degrees(30), Plane=area.Centroid)  # -> Geometry, Transform
scale_24 = Scale(Geometry=rotate_6.Geometry, Center=area.Centroid, Factor="SQRT(3)/2")  # -> Geometry, Transform
geometry_4 = Geometry(scale_24.Geometry)

stream_filter_4 = StreamFilter(Gate=Slider(0, range=0..1), Stream0=geometry_3, Stream1=geometry_4)
geometry_5 = Geometry(stream_filter_4)
scale_25 = Scale(Geometry=geometry_5, Center=Point(0, 0, 0), Factor="64/81")  # -> Geometry, Transform
scale_26 = Scale(Geometry=geometry_5, Center=Point(0, 0, 0), Factor="8/9")  # -> Geometry, Transform
scale_27 = Scale(Geometry=geometry_5, Center=Point(0, 0, 0), Factor="76/81")  # -> Geometry, Transform
scale_28 = Scale(Geometry=geometry_5, Center=Point(0, 0, 0), Factor=0.4444444444)  # -> Geometry, Transform
scale_29 = Scale(Geometry=geometry_5, Center=Point(0, 0, 0), Factor="68/81")  # -> Geometry, Transform
scale_30 = Scale(Geometry=geometry_5, Center=Point(0, 0, 0), Factor="32/81")  # -> Geometry, Transform
scale_31 = Scale(Geometry=geometry_5, Center=Point(0, 0, 0), Factor="10/27")  # -> Geometry, Transform
scale_32 = Scale(Geometry=geometry_5, Center=Point(0, 0, 0), Factor="80/81")  # -> Geometry, Transform
scale_33 = Scale(Geometry=geometry_5, Center=Point(0, 0, 0), Factor="28/81")  # -> Geometry, Transform
scale_34 = Scale(Geometry=geometry_5, Center=Point(0, 0, 0), Factor="40/81")  # -> Geometry, Transform
scale_35 = Scale(Geometry=geometry_5, Center=Point(0, 0, 0), Factor="22/27")  # -> Geometry, Transform
scale_36 = Scale(Geometry=geometry_5, Center=Point(0, 0, 0), Factor="26/27")  # -> Geometry, Transform
geometry_6 = Geometry(scale_25.Geometry)
scale_37 = Scale(Geometry=geometry_5, Center=Point(0, 0, 0), Factor="44/81")  # -> Geometry, Transform
scale_38 = Scale(Geometry=geometry_5, Center=Point(0, 0, 0), Factor="14/27")  # -> Geometry, Transform
geometry_7 = Geometry(scale_26.Geometry)
geometry_8 = Geometry(scale_27.Geometry)
geometry_9 = Geometry(scale_28.Geometry)
geometry_10 = Geometry(scale_29.Geometry)
geometry_11 = Geometry(scale_30.Geometry)
geometry_12 = Geometry(scale_31.Geometry)
geometry_13 = Geometry(scale_32.Geometry)
geometry_14 = Geometry(scale_33.Geometry)
geometry_15 = Geometry(scale_34.Geometry)
divide_curve_11 = DivideCurve(Curve=geometry_6, Count=multiplication_4, Kinks=False)  # -> Points, Tangents, Parameters
cull_nth_plus = CullNthPlus(List=divide_curve_11.Points, CullFrequency=2)  # -> RemainList, RemoveList
geometry_16 = Geometry(scale_35.Geometry)
geometry_17 = Geometry(scale_36.Geometry)
divide_curve_12 = DivideCurve(Curve=geometry_7, Count=multiplication_5, Kinks=False)  # -> Points, Tangents, Parameters
cull_nth_plus_2 = CullNthPlus(List=divide_curve_12.Points, CullFrequency=2)  # -> RemainList, RemoveList
divide_curve_13 = DivideCurve(Curve=geometry_8, Count=multiplication_6, Kinks=False)  # -> Points, Tangents, Parameters
cull_nth_plus_3 = CullNthPlus(List=divide_curve_13.Points, CullFrequency=2)  # -> RemainList, RemoveList
divide_curve_14 = DivideCurve(Curve=geometry_9, Count=multiplication_7, Kinks=False)  # -> Points, Tangents, Parameters
cull_nth_plus_4 = CullNthPlus(List=divide_curve_14.Points, CullFrequency=2)  # -> RemainList, RemoveList
stream_filter_5 = StreamFilter(Gate=number_slider_6, Stream0=cull_nth_plus_2.RemainList, Stream1=cull_nth_plus_2.RemoveList)
stream_filter_6 = StreamFilter(Gate=number_slider_6, Stream0=cull_nth_plus.RemainList, Stream1=cull_nth_plus.RemoveList)
geometry_18 = Geometry(scale_37.Geometry)
divide_curve_15 = DivideCurve(Curve=geometry_10, Count=multiplication_8, Kinks=False)  # -> Points, Tangents, Parameters
cull_nth_plus_5 = CullNthPlus(List=divide_curve_15.Points, CullFrequency=2)  # -> RemainList, RemoveList
geometry_19 = Geometry(stream_filter_5)
geometry_20 = Geometry(scale_38.Geometry)
geometry_21 = Geometry(stream_filter_6)
stream_filter_7 = StreamFilter(Gate=number_slider_6, Stream0=cull_nth_plus_4.RemainList, Stream1=cull_nth_plus_4.RemoveList)
divide_curve_16 = DivideCurve(Curve=geometry_11, Count=multiplication_9, Kinks=False)  # -> Points, Tangents, Parameters
cull_nth_plus_6 = CullNthPlus(List=divide_curve_16.Points, CullFrequency=2)  # -> RemainList, RemoveList
stream_filter_8 = StreamFilter(Gate=number_slider_6, Stream0=cull_nth_plus_3.RemainList, Stream1=cull_nth_plus_3.RemoveList)
divide_curve_17 = DivideCurve(Curve=geometry_12, Count=multiplication_10, Kinks=False)  # -> Points, Tangents, Parameters
cull_nth_plus_7 = CullNthPlus(List=divide_curve_17.Points, CullFrequency=2)  # -> RemainList, RemoveList
divide_curve_18 = DivideCurve(Curve=geometry_13, Count=multiplication_11, Kinks=False)  # -> Points, Tangents, Parameters
cull_nth_plus_8 = CullNthPlus(List=divide_curve_18.Points, CullFrequency=2)  # -> RemainList, RemoveList
geometry_22 = Geometry(stream_filter_8)
geometry_23 = Geometry(stream_filter_7)
stream_filter_9 = StreamFilter(Gate=number_slider_6, Stream0=cull_nth_plus_5.RemainList, Stream1=cull_nth_plus_5.RemoveList)
divide_curve_19 = DivideCurve(Curve=geometry_14, Count=multiplication_12, Kinks=False)  # -> Points, Tangents, Parameters
cull_nth_plus_9 = CullNthPlus(List=divide_curve_19.Points, CullFrequency=2)  # -> RemainList, RemoveList
geometry_24 = Geometry(stream_filter_9)
divide_curve_20 = DivideCurve(Curve=geometry_15, Count=multiplication_13, Kinks=False)  # -> Points, Tangents, Parameters
cull_nth_plus_10 = CullNthPlus(List=divide_curve_20.Points, CullFrequency=2)  # -> RemainList, RemoveList
stream_filter_10 = StreamFilter(Gate=number_slider_6, Stream0=cull_nth_plus_6.RemainList, Stream1=cull_nth_plus_6.RemoveList)
divide_curve_21 = DivideCurve(Curve=geometry_16, Count=multiplication_14, Kinks=False)  # -> Points, Tangents, Parameters
cull_nth_plus_11 = CullNthPlus(List=divide_curve_21.Points, CullFrequency=2)  # -> RemainList, RemoveList
stream_filter_11 = StreamFilter(Gate=number_slider_6, Stream0=cull_nth_plus_8.RemainList, Stream1=cull_nth_plus_8.RemoveList)
stream_filter_12 = StreamFilter(Gate=number_slider_6, Stream0=cull_nth_plus_7.RemainList, Stream1=cull_nth_plus_7.RemoveList)
geometry_25 = Geometry(stream_filter_10)
divide_curve_22 = DivideCurve(Curve=geometry_17, Count=multiplication_15, Kinks=False)  # -> Points, Tangents, Parameters
cull_nth_plus_12 = CullNthPlus(List=divide_curve_22.Points, CullFrequency=2)  # -> RemainList, RemoveList
geometry_26 = Geometry(stream_filter_11)
stream_filter_13 = StreamFilter(Gate=number_slider_6, Stream0=cull_nth_plus_9.RemainList, Stream1=cull_nth_plus_9.RemoveList)
geometry_27 = Geometry(stream_filter_12)
stream_filter_14 = StreamFilter(Gate=number_slider_6, Stream0=cull_nth_plus_12.RemainList, Stream1=cull_nth_plus_12.RemoveList)
stream_filter_15 = StreamFilter(Gate=number_slider_6, Stream0=cull_nth_plus_10.RemainList, Stream1=cull_nth_plus_10.RemoveList)
divide_curve_23 = DivideCurve(Curve=geometry_18, Count=multiplication_17, Kinks=False)  # -> Points, Tangents, Parameters
cull_nth_plus_13 = CullNthPlus(List=divide_curve_23.Points, CullFrequency=2)  # -> RemainList, RemoveList
stream_filter_16 = StreamFilter(Gate=number_slider_6, Stream0=cull_nth_plus_11.RemainList, Stream1=cull_nth_plus_11.RemoveList)
geometry_28 = Geometry(stream_filter_13)
divide_curve_24 = DivideCurve(Curve=geometry_20, Count=multiplication_16, Kinks=False)  # -> Points, Tangents, Parameters
cull_nth_plus_14 = CullNthPlus(List=divide_curve_24.Points, CullFrequency=2)  # -> RemainList, RemoveList
geometry_29 = Geometry(stream_filter_15)
geometry_30 = Geometry(stream_filter_16)
geometry_31 = Geometry(stream_filter_14)
stream_filter_17 = StreamFilter(Gate=number_slider_6, Stream0=cull_nth_plus_13.RemainList, Stream1=cull_nth_plus_13.RemoveList)
stream_filter_18 = StreamFilter(Gate=number_slider_6, Stream0=cull_nth_plus_14.RemainList, Stream1=cull_nth_plus_14.RemoveList)
geometry_32 = Geometry(stream_filter_18)
geometry_33 = Geometry(stream_filter_17)
scale_39 = Scale(Geometry=circumscribed_polygon_2, Center=Point(0, 0, 0), Factor=0.3333333333)  # -> Geometry, Transform
scale_40 = Scale(Geometry=geometry_5, Center=Point(0, 0, 0), Factor=0.3333333333)  # -> Geometry, Transform
merge_7 = Merge(Data2=divide_curve_10.Points)  # disabled
fast_loop_start_6 = FastLoopStart(Iterations=digit_scroller_8, Data=boundary_surfaces)  # -> port, Counter, Data; disabled
list_item_2 = ListItem(List=scale_23.Geometry, Index=1, Wrap=True)  # disabled
fast_loop_end = FastLoopEnd(port=fast_loop_start.port, Exit=False, Data=scale_17.Geometry, RecordData=True, TimeOutVal=0)  # disabled
fast_loop_end_2 = FastLoopEnd(port=fast_loop_start_2.port, Exit=False, Data=scale_19.Geometry, RecordData=True, TimeOutVal=0)
fast_loop_end_3 = FastLoopEnd(port=fast_loop_start_3.port, Exit=False, Data=scale_20.Geometry, RecordData=True, TimeOutVal=0)
fast_loop_end_4 = FastLoopEnd(port=fast_loop_start_4.port, Exit=False, Data=scale_18.Geometry, RecordData=True, TimeOutVal=0)  # disabled
button_2 = Button()  # disabled
rotate_7 = Rotate(Geometry=fast_loop_end_2, Angle=1.570796327, Plane=PlaneYZ(0, 0, 0))  # -> Geometry, Transform
digit_scroller_9 = DigitScroller(Scroller_Digits=12, Scroller_Prefix="Digit Scroller", Scroller_Radix=11, Scroller_Value=1)  # disabled
fast_loop_start_7 = FastLoopStart(Iterations=digit_scroller_9, Data=boundary_surfaces_5)  # -> port, Counter, Data; disabled
rotate_8 = Rotate(Geometry=fast_loop_end_3, Angle=1.570796327, Plane=PlaneYZ(0, 0, 0))  # -> Geometry, Transform
panel_2 = Panel("SQRT(3)/2")  # disabled
division_21 = Division(A="60686", B="59049")
panel_3 = Panel("SQRT(3)/2")  # disabled
division_22 = Division(A="64418", B="59049")
circumscribed_polygon_3 = CircumscribedPolygon(Plane=rotate.Geometry, Radius=division_14, Sides=6)
scale_41 = Scale(Geometry=circumscribed_polygon_3, Center=Point(0, 0, 0), Factor=1)  # -> Geometry, Transform
fast_loop_start_8 = FastLoopStart(Iterations=-1, Data=scale_41.Geometry)  # -> port, Counter, Data; disabled
scale_42 = Scale(Geometry=graft(fast_loop_start_8.Data), Center=discontinuity.Points, Factor=0.3333333333)  # -> Geometry, Transform
fast_loop_end_5 = FastLoopEnd(port=fast_loop_start_8.port, Exit=False, Data=scale_42.Geometry, RecordData=True, TimeOutVal=0)  # disabled
merge_8 = Merge(Data1=scale_41.Geometry, Data2=fast_loop_end_5)
subdivide_triangle = SubdivideTriangle(TriangularCurve=merge_8, Subdivide=0, Boolean1=False, Boolean2=True, Boolean3=True, Boolean4=True, Wires=True)  # -> TriangleCellsA, TriangleCellsB
weaverbird_s_split_triangles_subdivision_2 = WeaverbirdsSplitTrianglesSubdivision(MeshCurves=merge_8, Level=3)
face_boundaries_2 = FaceBoundaries(Mesh=weaverbird_s_split_triangles_subdivision_2)
cull_index_2 = CullIndex(List=face_boundaries_2, Indices=indices, Wrap=True)
list_item_3 = ListItem(List=face_boundaries_2, Index=indices, Wrap=True)
weaverbird_s_sierpinski_triangles_subdiv = WeaverbirdsSierpinskiTrianglesSubdivision(MeshCurves=merge_8, Level=2)
merge_9 = Merge(Data1=merge_8)  # -> flatten(Result)
recursive_transform = RecursiveTransform(Geometry=scale_41.Geometry, Transform=scale_22.Transform, Steps=4, Last=False)  # disabled
mirror_curve = MirrorCurve(Geometry=merge_8, Curve=circumscribed_polygon_3, Tangent=True)  # disabled
explode_2 = Explode(Curve=circumscribed_polygon_3, Recursive=True)  # -> Segments, Vertices
scale_43 = Scale(Geometry=graft(fast_loop_start_5.Data), Center=flatten(divide_curve_8.Points), Factor=0.3333333333)  # -> Geometry, Transform; disabled
division_23 = Division(A="3004", B="2187")
merge_10 = Merge(Data1=scale.Geometry, Data2=fast_loop_end_4)  # disabled
division_24 = Division(A=".5", B="243")
divide_curve_25 = DivideCurve(Curve=list_item_2, Count=2, Kinks=False)  # -> Points, Tangents, Parameters; disabled
explode_3 = Explode(Curve=scale_21.Geometry, Recursive=True)  # -> Segments, Vertices; disabled
division_25 = Division(A=".5", B="81")
scale_44 = Scale(Geometry=fast_loop_end, Center=construct_point_5, Factor=1)  # -> Geometry, Transform; disabled
move = Move(Geometry=fast_loop_end, Motion=construct_point_4)  # -> Geometry, Transform; disabled
division_26 = Division(A=".5", B="27")
point_7 = Point(Point(0, 0, 0))  # disabled
deconstruct_arc_2 = DeconstructArc(Arc=scale_23.Geometry)  # -> BasePlane, Radius, Angle; disabled
deconstruct_arc_3 = DeconstructArc(Arc=fast_loop_end_4)  # -> BasePlane, Radius, Angle; disabled
geometry_34 = Geometry(polar_array.Geometry)
scale_45 = Scale(Geometry=graft(fast_loop_start_6.Data), Center=flatten(divide_curve_8.Points), Factor=0.3333333333)  # -> Geometry, Transform; disabled
deconstruct_arc_4 = DeconstructArc(Arc=list_item_2)  # -> BasePlane, Radius, Angle; disabled
curve_middle_2 = CurveMiddle(Curve=explode_3.Segments)  # disabled
merge_11 = Merge(Data1=simplify(flatten(point_7)), Data2=simplify(flatten(curve_middle_2)))  # disabled
scale_46 = Scale(Geometry=graft(fast_loop_start_7.Data), Center=flatten(divide_curve_10.Points), Factor=0.3333333333)  # -> Geometry, Transform; disabled
scale_47 = Scale(Geometry=scale_23.Geometry, Center=graft(deconstruct_arc_2.BasePlane), Factor=0.3333333333)  # -> Geometry, Transform; disabled
panel_4 = Panel("SQRT(3)/2")  # disabled
division_27 = Division(A=".5", B="9")
panel_5 = Panel("SQRT(3)/2")  # disabled
deconstruct = Deconstruct(Point=deconstruct_arc_3.BasePlane)  # -> XComponent, YComponent, ZComponent; disabled
larger_than = LargerThan(FirstNumber=deconstruct.XComponent, SecondNumber=0)  # -> LargerThan, OrEqualTo; disabled
power_2 = Power(A="2", B="16")
scale_48 = Scale(Geometry=rotate_7.Geometry, Center=Point(0, 0, 0), Factor=power_2)  # -> Geometry, Transform
scale_49 = Scale(Geometry=geometry_34, Center=Point(0, 0, 0), Factor=division_23)  # -> Geometry, Transform
scale_50 = Scale(Geometry=scale_49.Geometry, Center=Point(0, 0, 0), Factor=division_22)  # -> Geometry, Transform
scale_51 = Scale(Geometry=scale_50.Geometry, Center=Point(0, 0, 0), Factor=division_21)  # -> Geometry, Transform
expression_7 = Expression(Expression=".5/3")  # disabled
multiplication_20 = Multiplication(A=".5", B=panel)  # disabled
construct_point_6 = ConstructPoint(XCoordinate=0, YCoordinate=multiplication_20, ZCoordinate=0)  # disabled
scale_52 = Scale(Geometry=scale_21.Geometry, Center=graft(merge_5), Factor=0.3333333333)  # -> Geometry, Transform; disabled
scale_53 = Scale(Geometry=circumscribed_polygon_3, Center=Point(0, 0, 0), Factor=0.3333333333)  # -> Geometry, Transform
division_28 = Division(A="-1", B="81")
number_slider_9 = Slider(1, range=0..1)  # disabled
panel_6 = Panel("SQRT(3)/2")  # disabled
panel_7 = Panel("SQRT(3)/2")  # disabled
panel_8 = Panel("SQRT(3)/2")  # disabled
multiplication_21 = Multiplication(A=division_28, B="2/SQRT(3)")
merge_12 = Merge(Data1=deconstruct_arc_4.BasePlane, Data2=divide_curve_25.Points)  # disabled
panel_9 = Panel("SQRT(3)/2")  # disabled
project = Project(Geometry=scale_48.Geometry, Plane=PlaneXY(0, 0, 0))  # -> Geometry, Transform
polar_array_2 = PolarArray(Geometry=move.Geometry, Plane=PlaneXY(0, 0, 0), Count=6, Angle=6.283185307)  # -> Geometry, Transform; disabled
project_2 = Project(Geometry=rotate_8.Geometry, Plane=PlaneXY(0, 0, 0))  # -> Geometry, Transform
fast_loop_end_6 = FastLoopEnd(port=fast_loop_start_5.port, Exit=False, Data=scale_43.Geometry, RecordData=True, TimeOutVal=0)  # disabled
panel_10 = Panel("SQRT(3)/2")  # disabled
fast_loop_start_9 = FastLoopStart(Iterations=2, Data=scale_53.Geometry)  # -> port, Counter, Data; disabled
panel_11 = Panel("SQRT(3)/2")  # disabled
cull_pattern_2 = CullPattern(List=fast_loop_end_4, CullPattern=larger_than.OrEqualTo)  # disabled
scale_54 = Scale(Geometry=cull_pattern_2, Center=Point(0.5, 0, 0), Factor=0.3333333333)  # -> Geometry, Transform; disabled
geometry_35 = Geometry(circumscribed_polygon_2)
rail_revolution = RailRevolution(Curve=project_2.Geometry, Rail=geometry_35, Axis=Line((0, 0, 0), (0, 0, 1)), Scale=False)
fast_loop_end_7 = FastLoopEnd(port=fast_loop_start_6.port, Exit=False, Data=scale_45.Geometry, RecordData=False, TimeOutVal=0)  # disabled
construct_point_7 = ConstructPoint(XCoordinate=0, YCoordinate=expression_3, ZCoordinate=0)  # disabled
move_2 = Move(Geometry=fast_loop_end, Motion=construct_point_7)  # -> Geometry, Transform; disabled
tri_fan_polyline = TriFanPolyline(Polyline=geometry_5)
vector_xyz_4 = VectorXYZ(XComponent=0, YComponent=multiplication_21, ZComponent=0)  # -> Vector, Length
digit_scroller_10 = DigitScroller(Scroller_Digits=12, Scroller_Prefix="Digit Scroller", Scroller_Radix=1, Scroller_Value=0.0855333732)
point_8 = Point(merge_12)  # disabled
panel_12 = Panel("SQRT(3)/2")  # disabled
fast_loop_end_8 = FastLoopEnd(port=fast_loop_start_7.port, Exit=False, Data=scale_46.Geometry, RecordData=False, TimeOutVal=0)  # disabled
scale_55 = Scale(Geometry=project.Geometry, Center=Point(0, 0, 0), Factor=expr("1/X", power_2))  # -> Geometry, Transform
merge_13 = Merge(Data1=geometry_5, Data2=scale_40.Geometry)
curve_display_2 = CurveDisplay(Curves=merge_13, Thickness=1, Color=RGB(0, 255, 255))
triangular_3 = Triangular(
    Plane=Plane(origin=(0, -0.8981004173, 0), x=(0.8660254038, 0.5, 0), y=(-0.5, 0.8660254038, 0)),
    Size="4/(27*sqrt(3))",
    ExtentX=21,
    ExtentY=3)  # -> Cells, Points
scale_56 = Scale(Geometry=list_item_2, Center=flatten(point_8), Factor=0.3333333333)  # -> Geometry, Transform; disabled
offset_curve = OffsetCurve(Curve=geometry_34, Plane=PlaneXY(0, 0, 0), Distance=division_27, BothSides=expr("-X", division_27), Kinks=1, CapType=3)
offset_curve_2 = OffsetCurve(
    Curve=scale_49.Geometry,
    Plane=PlaneXY(0, 0, 0),
    Distance=division_26,
    BothSides=expr("-X", division_26),
    Kinks=1,
    CapType=3)
offset_curve_3 = OffsetCurve(
    Curve=scale_51.Geometry,
    Plane=PlaneXY(0, 0, 0),
    Distance=division_24,
    BothSides=expr("-X", division_24),
    Kinks=1,
    CapType=3)  # disabled
offset_curve_4 = OffsetCurve(
    Curve=scale_50.Geometry,
    Plane=PlaneXY(0, 0, 0),
    Distance=division_25,
    BothSides=expr("-X", division_25),
    Kinks=1,
    CapType=3)
sphere = Sphere(Base=PlaneXY(0, 0, 0), Radius=0.5)  # disabled
digit_scroller_11 = DigitScroller(Scroller_Digits=12, Scroller_Prefix="Digit Scroller", Scroller_Radix=11, Scroller_Value=18)
scale_57 = Scale(Geometry=flatten(scale_52.Geometry), Center=graft(merge_5), Factor=0.3333333333)  # -> Geometry, Transform; disabled
polar_array_3 = PolarArray(Geometry=cull_pattern_2, Plane=PlaneXY(0, 0, 0), Count=6, Angle=6.283185307)  # -> Geometry, Transform; disabled
weaverbird_s_split_triangles_subdivision_3 = WeaverbirdsSplitTrianglesSubdivision(MeshCurves=tri_fan_polyline, Level=3)
subdivide_triangle_2 = SubdivideTriangle(TriangularCurve=tri_fan_polyline, Subdivide=0, Boolean1=True, Boolean2=True, Boolean3=True, Boolean4=True, Wires=True)  # -> TriangleCellsA, TriangleCellsB
weaverbird_s_sierpinski_triangles_subdiv_2 = WeaverbirdsSierpinskiTrianglesSubdivision(MeshCurves=tri_fan_polyline, Level=0)
polar_array_4 = PolarArray(Geometry=move_2.Geometry, Plane=PlaneXY(0, 0, 0), Count=6, Angle=6.283185307)  # -> Geometry, Transform; disabled
curve_middle_3 = CurveMiddle(Curve=explode_2.Segments)
point_9 = Point(Point(0, 0, 0))
geometry_36 = Geometry(fast_loop_end_8)  # disabled
list_item_4 = ListItem(List=flatten(scale_23.Geometry), Index=0, Wrap=True)  # disabled
digit_scroller_12 = DigitScroller(Scroller_Digits=12, Scroller_Prefix="Digit Scroller", Scroller_Radix=11, Scroller_Value=1)  # disabled
bounding_rectangle = BoundingRectangle(Content={Plane=PlaneXY(0, 0, 0), Radius=0.5}, Plane=PlaneXY(0, 0, 0), UnionRec=True)  # disabled
rail_revolution_2 = RailRevolution(Curve=scale_55.Geometry, Rail=geometry_35, Axis=Line((0, 0, 0), (0, 0, 1)), Scale=False)
panel_13 = Panel("SQRT(3)/2")  # disabled
panel_14 = Panel("SQRT(3)/2")  # disabled
scale_58 = Scale(Geometry=fast_loop_end_8, Center=Point(0, 0, 0), Factor=0.3333333333)  # -> Geometry, Transform; disabled
scale_59 = Scale(Geometry=flatten(scale_57.Geometry), Center=graft(merge_5), Factor=0.3333333333)  # -> Geometry, Transform; disabled
polar_array_5 = PolarArray(Geometry=scale_56.Geometry, Plane=PlaneXY(0, 0, 0), Count=6, Angle=6.283185307)  # -> Geometry, Transform; disabled
divide_curve_26 = DivideCurve(Curve=list_item_4, Count=6, Kinks=False)  # -> Points, Tangents, Parameters; disabled
custom_preview = CustomPreview(
    Geometry=geometry_36,
    Material={diffuse=RGB(211, 222, 160), emission=RGB(63, 67, 48), shine=0.5, specular=RGB(255, 255, 255), transparency=0})  # disabled
merge_14 = Merge(Data2=curve_middle_3)
scale_60 = Scale(Geometry=graft(fast_loop_start_9.Data), Center=flatten(merge_14), Factor=0.3333333333)  # -> Geometry, Transform; disabled
merge_15 = Merge(Data1=fast_loop_start_9.Data, Data2=scale_60.Geometry)
boundary_surfaces_6 = BoundarySurfaces(Edges=scale_59.Geometry)  # disabled
deconstruct_arc_5 = DeconstructArc(Arc=list_item_4)  # -> BasePlane, Radius, Angle; disabled
panel_15 = Panel("SQRT(3)/2")  # disabled
fast_loop_end_9 = FastLoopEnd(port=fast_loop_start_9.port, Exit=False, Data=scale_60.Geometry, RecordData=True, TimeOutVal=0)  # disabled
scale_61 = Scale(Geometry=fast_loop_end_9, Center=Point(0, 0, 0), Factor=0.3333333333)  # -> Geometry, Transform; disabled
brep_centroid = BrepCentroid(Brep=sphere)  # disabled
merge_16 = Merge(Data1=scale_40.Geometry, Data2=offset_curve, Data3=offset_curve_2, Data4=offset_curve_4, Data5=offset_curve_3)
geometry_37 = Geometry(subdivide_triangle_2.TriangleCellsB)
area_2 = Area(Geometry=subdivide_triangle_2.TriangleCellsB)  # -> Area, Centroid
face_boundaries_3 = FaceBoundaries(Mesh=weaverbird_s_split_triangles_subdivision_3)
list_item_5 = ListItem(List=face_boundaries_3, Index=digit_scroller_11, Wrap=True)  # disabled
boundary_surfaces_7 = BoundarySurfaces(Edges=list_item_5)  # disabled
fast_loop_start_10 = FastLoopStart(Iterations=0, Data=sphere, D1=brep_centroid)  # -> port, Counter, Data, Data_2, Data_3; disabled
cull_index_3 = CullIndex(List=face_boundaries_3, Indices=[0, 9, 18, 27, 36, 45], Wrap=False)
recursive_transform_2 = RecursiveTransform(Geometry=scale_61.Geometry, Transform=scale_61.Transform, Steps=3, Last=False)  # disabled
boundary_surfaces_8 = BoundarySurfaces()  # disabled
cull_index_4 = CullIndex(List=divide_curve_26.Points, Indices=[2, 4], Wrap=False)  # disabled
cull_index_5 = CullIndex(List=polar_array_3.Geometry, Indices=[2, 4], Wrap=False)  # disabled
merge_17 = Merge(Data1=scale.Geometry, Data2=cull_index_5)  # disabled
stream_filter_19 = StreamFilter(Gate=2, Stream0=scale.Geometry, Stream1=cull_index_5, Stream2=merge_17)  # disabled
scale_62 = Scale(Geometry=stream_filter_19, Center=Point(-0.5, 0, 0), Factor=0.3333333333)  # -> Geometry, Transform; disabled
merge_18 = Merge(Data1=subdivide_triangle_2.TriangleCellsA, Data2=subdivide_triangle_2.TriangleCellsB)
boundary_surfaces_9 = BoundarySurfaces(Edges=merge_16)
merge_19 = Merge(Data2=fast_loop_end_9)
custom_preview_2 = CustomPreview(
    Geometry=boundary_surfaces_8,
    Material={diffuse=RGB(68, 255, 0), emission=RGB(20, 76, 0), shine=0.5, specular=RGB(255, 255, 255), transparency=0})  # disabled
merge_20 = Merge(Data1=fast_loop_end_9, Data2=recursive_transform_2)  # disabled
series = Series(Start=0, Step=1, Count=2)  # -> graft(Series); disabled
weaverbird_s_split_triangles_subdivision_4 = WeaverbirdsSplitTrianglesSubdivision(MeshCurves=cull_index_3, Level=3)

line_3 = Line(Tree({0;0;0}: [Line((0, 0, 0), (0, 0.3333333333, 0)), Line((0, 0, 0), (-0.2886751354, 0.1666666652, 0)), Line((0, 0, 0), (-0.2886751355, -0.1666666651, 0)), Line((0, 0, 0), (0, -0.3333333333, 0)), Line((0, 0, 0), (0.2886751354, -0.1666666652, 0)), Line((0, 0, 0), (0.2886751355, 0.1666666651, 0))], {1;0;0;0}: [Line((0, 0.3333333333, 0), (0, 0.4444444444, 0)), Line((-0.2886751354, 0.1666666652, 0), (-0.2886751354, 0.2777777763, 0)), Line((-0.2886751355, -0.1666666651, 0), (-0.2886751355, -0.05555555396, 0)), Line((0, -0.3333333333, 0), (0, -0.2222222222, 0)), Line((0.2886751354, -0.1666666652, 0), (0.2886751354, -0.05555555412, 0)), Line((0.2886751355, 0.1666666651, 0), (0.2886751355, 0.2777777762, 0))], {1;0;0;1}: [Line((0, 0.3333333333, 0), (-0.09622504514, 0.3888888884, 0)), Line((-0.2886751354, 0.1666666652, 0), (-0.3849001806, 0.2222222203, 0)), Line((-0.2886751355, -0.1666666651, 0), (-0.3849001807, -0.11111111, 0)), Line((0, -0.3333333333, 0), (-0.09622504514, -0.2777777783, 0)), Line((0.2886751354, -0.1666666652, 0), (0.1924500903, -0.1111111102, 0)), Line((0.2886751355, 0.1666666651, 0), (0.1924500904, 0.2222222201, 0))], {1;0;0;2}: [Line((0, 0.3333333333, 0), (-0.09622504517, 0.2777777783, 0)), Line((-0.2886751354, 0.1666666652, 0), (-0.3849001806, 0.1111111102, 0)), Line((-0.2886751355, -0.1666666651, 0), (-0.3849001807, -0.2222222201, 0)), Line((0, -0.3333333333, 0), (-0.09622504517, -0.3888888884, 0)), Line((0.2886751354, -0.1666666652, 0), (0.1924500903, -0.2222222203, 0)), Line((0.2886751355, 0.1666666651, 0), (0.1924500903, 0.11111111, 0))], {1;0;0;3}: [Line((0, 0.3333333333, 0), (0, 0.2222222222, 0)), Line((-0.2886751354, 0.1666666652, 0), (-0.2886751354, 0.05555555412, 0)), Line((-0.2886751355, -0.1666666651, 0), (-0.2886751355, -0.2777777762, 0)), Line((0, -0.3333333333, 0), (0, -0.4444444444, 0)), Line((0.2886751354, -0.1666666652, 0), (0.2886751354, -0.2777777763, 0)), Line((0.2886751355, 0.1666666651, 0), (0.2886751355, 0.05555555396, 0))], {1;0;0;4}: [Line((0, 0.3333333333, 0), (0.09622504514, 0.2777777783, 0)), Line((-0.2886751354, 0.1666666652, 0), (-0.1924500903, 0.1111111102, 0)), Line((-0.2886751355, -0.1666666651, 0), (-0.1924500904, -0.2222222201, 0)), Line((0, -0.3333333333, 0), (0.09622504514, -0.3888888884, 0)), Line((0.2886751354, -0.1666666652, 0), (0.3849001806, -0.2222222203, 0)), Line((0.2886751355, 0.1666666651, 0), (0.3849001807, 0.11111111, 0))], {1;0;0;5}: [Line((0, 0.3333333333, 0), (0.09622504517, 0.3888888884, 0)), Line((-0.2886751354, 0.1666666652, 0), (-0.1924500903, 0.2222222203, 0)), Line((-0.2886751355, -0.1666666651, 0), (-0.1924500903, -0.11111111, 0)), Line((0, -0.3333333333, 0), (0.09622504517, -0.2777777783, 0)), Line((0.2886751354, -0.1666666652, 0), (0.3849001806, -0.1111111102, 0)), Line((0.2886751355, 0.1666666651, 0), (0.3849001807, 0.2222222201, 0))]))  # disabled
line_4 = Line(Tree({0}: [Line((0, 0.3333333333, 0), (0, 0.3333333333, 0)), Line((-0.2886751354, 0.1666666652, 0), (-0.2886751354, 0.1666666652, 0)), Line((-0.2886751355, -0.1666666651, 0), (-0.2886751355, -0.1666666651, 0)), Line((0, -0.3333333333, 0), (0, -0.3333333333, 0)), Line((0.2886751354, -0.1666666652, 0), (0.2886751354, -0.1666666652, 0)), Line((0.2886751355, 0.1666666651, 0), (0.2886751355, 0.1666666651, 0))], {1;0}: [Line((0, 0.4444444444, 0), (0, 0.4444444444, 0)), Line((-0.2886751354, 0.2777777763, 0), (-0.2886751354, 0.2777777763, 0)), Line((-0.2886751355, -0.05555555396, 0), (-0.2886751355, -0.05555555396, 0)), Line((0, -0.2222222222, 0), (0, -0.2222222222, 0)), Line((0.2886751354, -0.05555555412, 0), (0.2886751354, -0.05555555412, 0)), Line((0.2886751355, 0.2777777762, 0), (0.2886751355, 0.2777777762, 0))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], {2;0;0}: [Line((0, 0.4814814815, 0), (0, 0.4814814815, 0)), Line((-0.2886751354, 0.3148148134, 0), (-0.2886751354, 0.3148148134, 0)), Line((-0.2886751355, -0.01851851692, 0), (-0.2886751355, -0.01851851692, 0)), Line((0, -0.1851851852, 0), (0, -0.1851851852, 0)), Line((0.2886751354, -0.01851851708, 0), (0.2886751354, -0.01851851708, 0)), Line((0.2886751355, 0.3148148132, 0), (0.2886751355, 0.3148148132, 0))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], {3;0;0;0}: [Line((0, 0.4814814815, 0), (0, 0.4938271605, 0)), Line((-0.2886751354, 0.3148148134, 0), (-0.2886751354, 0.3271604924, 0)), Line((-0.2886751355, -0.01851851692, 0), (-0.2886751355, -0.006172837907, 0)), Line((0, -0.1851851852, 0), (0, -0.1728395062, 0)), Line((0.2886751354, -0.01851851708, 0), (0.2886751354, -0.006172838068, 0)), Line((0.2886751355, 0.3148148132, 0), (0.2886751355, 0.3271604922, 0))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], {3;0;0;1}: [Line((0, 0.4814814815, 0), (-0.01069167168, 0.4876543209, 0)), Line((-0.2886751354, 0.3148148134, 0), (-0.2993668071, 0.3209876528, 0)), Line((-0.2886751355, -0.01851851692, 0), (-0.2993668072, -0.01234567747, 0)), Line((0, -0.1851851852, 0), (-0.01069167168, -0.1790123457, 0)), Line((0.2886751354, -0.01851851708, 0), (0.2779834637, -0.01234567763, 0)), Line((0.2886751355, 0.3148148132, 0), (0.2779834638, 0.3209876527, 0))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], {3;0;0;2}: [Line((0, 0.4814814815, 0), (-0.01069167169, 0.475308642, 0)), Line((-0.2886751354, 0.3148148134, 0), (-0.2993668071, 0.3086419739, 0)), Line((-0.2886751355, -0.01851851692, 0), (-0.2993668072, -0.02469135637, 0)), Line((0, -0.1851851852, 0), (-0.01069167169, -0.1913580246, 0)), Line((0.2886751354, -0.01851851708, 0), (0.2779834637, -0.02469135653, 0)), Line((0.2886751355, 0.3148148132, 0), (0.2779834638, 0.3086419738, 0))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], {3;0;0;3}: [Line((0, 0.4814814815, 0), (0, 0.4691358025, 0)), Line((-0.2886751354, 0.3148148134, 0), (-0.2886751354, 0.3024691344, 0)), Line((-0.2886751355, -0.01851851692, 0), (-0.2886751355, -0.03086419593, 0)), Line((0, -0.1851851852, 0), (0, -0.1975308642, 0)), Line((0.2886751354, -0.01851851708, 0), (0.2886751354, -0.03086419609, 0)), Line((0.2886751355, 0.3148148132, 0), (0.2886751355, 0.3024691342, 0))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], {3;0;0;4}: [Line((0, 0.4814814815, 0), (0.01069167168, 0.475308642, 0)), Line((-0.2886751354, 0.3148148134, 0), (-0.2779834637, 0.3086419739, 0)), Line((-0.2886751355, -0.01851851692, 0), (-0.2779834638, -0.02469135637, 0)), Line((0, -0.1851851852, 0), (0.01069167168, -0.1913580246, 0)), Line((0.2886751354, -0.01851851708, 0), (0.2993668071, -0.02469135653, 0)), Line((0.2886751355, 0.3148148132, 0), (0.2993668072, 0.3086419738, 0))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], {3;0;0;5}: [Line((0, 0.4814814815, 0), (0.01069167169, 0.4876543209, 0)), Line((-0.2886751354, 0.3148148134, 0), (-0.2779834637, 0.3209876528, 0)), Line((-0.2886751355, -0.01851851692, 0), (-0.2779834638, -0.01234567747, 0)), Line((0, -0.1851851852, 0), (0.01069167169, -0.1790123457, 0)), Line((0.2886751354, -0.01851851708, 0), (0.2993668071, -0.01234567763, 0)), Line((0.2886751355, 0.3148148132, 0), (0.2993668072, 0.3209876527, 0))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]))  # disabled
line_5 = Line(Tree({1}: [Line((0, 0.4444444444, 0), (0, 0.4444444444, 0)), Line((-0.2886751354, 0.2777777763, 0), (-0.2886751354, 0.2777777763, 0)), Line((-0.2886751355, -0.05555555396, 0), (-0.2886751355, -0.05555555396, 0)), Line((0, -0.2222222222, 0), (0, -0.2222222222, 0)), Line((0.2886751354, -0.05555555412, 0), (0.2886751354, -0.05555555412, 0)), Line((0.2886751355, 0.2777777762, 0), (0.2886751355, 0.2777777762, 0))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], {2;0}: [Line((0, 0.4814814815, 0), (0, 0.4814814815, 0)), Line((-0.2886751354, 0.3148148134, 0), (-0.2886751354, 0.3148148134, 0)), Line((-0.2886751355, -0.01851851692, 0), (-0.2886751355, -0.01851851692, 0)), Line((0, -0.1851851852, 0), (0, -0.1851851852, 0)), Line((0.2886751354, -0.01851851708, 0), (0.2886751354, -0.01851851708, 0)), Line((0.2886751355, 0.3148148132, 0), (0.2886751355, 0.3148148132, 0))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], {3;0;0}: [Line((0, 0.4938271605, 0), (0, 0.4938271605, 0)), Line((-0.2886751354, 0.3271604924, 0), (-0.2886751354, 0.3271604924, 0)), Line((-0.2886751355, -0.006172837907, 0), (-0.2886751355, -0.006172837907, 0)), Line((0, -0.1728395062, 0), (0, -0.1728395062, 0)), Line((0.2886751354, -0.006172838068, 0), (0.2886751354, -0.006172838068, 0)), Line((0.2886751355, 0.3271604922, 0), (0.2886751355, 0.3271604922, 0))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], {4;0;0;0}: [Line((0, 0.4938271605, 0), (0, 0.4979423868, 0)), Line((-0.2886751354, 0.3271604924, 0), (-0.2886751354, 0.3312757187, 0)), Line((-0.2886751355, -0.006172837907, 0), (-0.2886751355, -0.00205761157, 0)), Line((0, -0.1728395062, 0), (0, -0.1687242798, 0)), Line((0.2886751354, -0.006172838068, 0), (0.2886751354, -0.002057611731, 0)), Line((0.2886751355, 0.3271604922, 0), (0.2886751355, 0.3312757186, 0))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], {4;0;0;1}: [Line((0, 0.4938271605, 0), (-0.003563890561, 0.4958847736, 0)), Line((-0.2886751354, 0.3271604924, 0), (-0.292239026, 0.3292181055, 0)), Line((-0.2886751355, -0.006172837907, 0), (-0.2922390261, -0.004115224756, 0)), Line((0, -0.1728395062, 0), (-0.003563890561, -0.170781893, 0)), Line((0.2886751354, -0.006172838068, 0), (0.2851112449, -0.004115224917, 0)), Line((0.2886751355, 0.3271604922, 0), (0.285111245, 0.3292181054, 0))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], {4;0;0;2}: [Line((0, 0.4938271605, 0), (-0.003563890562, 0.4917695473, 0)), Line((-0.2886751354, 0.3271604924, 0), (-0.292239026, 0.3251028792, 0)), Line((-0.2886751355, -0.006172837907, 0), (-0.2922390261, -0.008230451056, 0)), Line((0, -0.1728395062, 0), (-0.003563890562, -0.1748971193, 0)), Line((0.2886751354, -0.006172838068, 0), (0.2851112449, -0.008230451217, 0)), Line((0.2886751355, 0.3271604922, 0), (0.285111245, 0.3251028791, 0))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], {4;0;0;3}: [Line((0, 0.4938271605, 0), (0, 0.4897119342, 0)), Line((-0.2886751354, 0.3271604924, 0), (-0.2886751354, 0.3230452661, 0)), Line((-0.2886751355, -0.006172837907, 0), (-0.2886751355, -0.01028806424, 0)), Line((0, -0.1728395062, 0), (0, -0.1769547325, 0)), Line((0.2886751354, -0.006172838068, 0), (0.2886751354, -0.01028806441, 0)), Line((0.2886751355, 0.3271604922, 0), (0.2886751355, 0.3230452659, 0))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], {4;0;0;4}: [Line((0, 0.4938271605, 0), (0.003563890561, 0.4917695473, 0)), Line((-0.2886751354, 0.3271604924, 0), (-0.2851112449, 0.3251028792, 0)), Line((-0.2886751355, -0.006172837907, 0), (-0.285111245, -0.008230451058, 0)), Line((0, -0.1728395062, 0), (0.003563890561, -0.1748971193, 0)), Line((0.2886751354, -0.006172838068, 0), (0.292239026, -0.008230451219, 0)), Line((0.2886751355, 0.3271604922, 0), (0.2922390261, 0.3251028791, 0))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], {4;0;0;5}: [Line((0, 0.4938271605, 0), (0.003563890562, 0.4958847736, 0)), Line((-0.2886751354, 0.3271604924, 0), (-0.2851112449, 0.3292181055, 0)), Line((-0.2886751355, -0.006172837907, 0), (-0.285111245, -0.004115224758, 0)), Line((0, -0.1728395062, 0), (0.003563890562, -0.170781893, 0)), Line((0.2886751354, -0.006172838068, 0), (0.292239026, -0.004115224919, 0)), Line((0.2886751355, 0.3271604922, 0), (0.2922390261, 0.3292181054, 0))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]))  # disabled

brep_centroid_2 = BrepCentroid(Brep=fast_loop_start_10.Data)  # disabled
trim_tree = TrimTree(Tree=brep_centroid_2, Depth=1)  # disabled

merge_21 = Merge(Data1=deconstruct_arc_5.BasePlane, Data2=cull_index_4)  # disabled
polar_array_6 = PolarArray(Geometry=scale_62.Geometry, Plane=PlaneXY(0, 0, 0), Count=6, Angle=6.283185307)  # -> Geometry, Transform; disabled
scale_63 = Scale(Geometry=list_item_4, Center=flatten(merge_21), Factor=0.3333333333)  # -> Geometry, Transform; disabled
power_3 = Power(A="3", B=series)  # disabled
cull_index_6 = CullIndex(List=fast_loop_end_9, Indices=0, Wrap=True)  # disabled
digit_scroller_13 = DigitScroller(Scroller_Digits=12, Scroller_Prefix="Digit Scroller", Scroller_Radix=1, Scroller_Value=1.732050808)  # disabled
cull_index_7 = CullIndex(List=subdivide_triangle_2.TriangleCellsB, Indices=6, Wrap=True)
scale_64 = Scale(Geometry=subdivide_triangle_2.TriangleCellsB, Center=area_2.Centroid, Factor=0.3333333333)  # -> Geometry, Transform
face_boundaries_4 = FaceBoundaries(Mesh=weaverbird_s_split_triangles_subdivision_4)
digit_scroller_14 = DigitScroller(Scroller_Digits=12, Scroller_Prefix="Digit Scroller", Scroller_Radix=11, Scroller_Value=6)  # disabled
rotate_9 = Rotate(Geometry=face_boundaries_3, Angle=degrees(30), Plane=PlaneXY(0, 0, 0))  # -> Geometry, Transform
merge_22 = Merge(Data1=divide_curve_2.Points)  # disabled
rotate_10 = Rotate(Geometry=polar_array_6.Geometry, Angle=degrees(30), Plane=PlaneXY(0, 0, 0))  # -> Geometry, Transform; disabled
fast_loop_start_11 = FastLoopStart(Iterations=3, Data=rotate_10.Geometry)  # -> port, Counter, Data; disabled
mirror_curve_2 = MirrorCurve(Geometry=flatten(merge_20), Curve=graft(explode_2.Segments), Tangent=True)  # disabled
cull_index_8 = CullIndex(List=polar_array_5.Geometry, Indices=[2, 4], Wrap=False)  # disabled
boundary_surfaces_10 = BoundarySurfaces(Edges=[mirror_curve_2, merge_20])  # disabled
scale_65 = Scale(Geometry=graft(fast_loop_start_10.Data), Center=flatten(Point(0, 0, 0)), Factor=0.3333333333)  # -> Geometry, Transform; disabled
boundary_surfaces_11 = BoundarySurfaces(Edges=face_boundaries_4)  # disabled
power_4 = Power(A="3", B=digit_scroller_14)  # disabled
scale_66 = Scale(Center=Point(0, 0, 0), Factor=-0.5)  # -> Geometry, Transform; disabled
range = Range(Domain=Domain(0, 1), Steps=256)  # disabled
range_2 = Range(Domain=Domain(0, 1), Steps=256)  # disabled
division_29 = Division(A="59592", B="59049")
division_30 = Division(A="60686", B="59049")
division_31 = Division(A="64418", B="59049")
division_32 = Division(A=".5", B="729*3")
division_33 = Division(A=".5", B="243*3")
division_34 = Division(A="3004", B="2187")
scale_67 = Scale(Geometry=graft(fast_loop_start_11.Data), Center=flatten(Point(0, 0, 0)), Factor=0.3333333333)  # -> Geometry, Transform; disabled
division_35 = Division(A=".5", B="81*3")
division_36 = Division(A=".5", B="27*3")
expression_8 = Expression(X=range_2, Expression="X")  # disabled
pi = Pi(Factor=digit_scroller_13)  # disabled
expression_9 = Expression(X=range, A=pi, M=power_3, Expression="SIN(X*PI*M)/(SQRT(3)*PI)/M")  # disabled
geometry_38 = Geometry(polar_array.Geometry)
division_37 = Division(A=".5", B="9*3")
circle_3 = Circle(Plane=PlaneXY(0, 0, 0), Radius=1)  # disabled
list_item_6 = ListItem(List=cull_index_8, Index=0, Wrap=True)  # disabled
brep_centroid_3 = BrepCentroid(Brep=scale_65.Geometry)  # disabled
cull_index_9 = CullIndex(List=scale_63.Geometry, Indices=[2, 4], Wrap=False)  # disabled
scale_68 = Scale(Geometry=geometry_38, Center=Point(0, 0, 0), Factor=division_34)  # -> Geometry, Transform
scale_69 = Scale(Geometry=scale_68.Geometry, Center=Point(0, 0, 0), Factor=division_31)  # -> Geometry, Transform
scale_70 = Scale(Geometry=scale_69.Geometry, Center=Point(0, 0, 0), Factor=division_30)  # -> Geometry, Transform
scale_71 = Scale(Geometry=scale_70.Geometry, Center=Point(0, 0, 0), Factor=division_29)  # -> Geometry, Transform
list_item_7 = ListItem(List=flatten(scale_63.Geometry), Index=0, Wrap=True)  # disabled
divide_curve_27 = DivideCurve(Curve=list_item_6, Count=2, Kinks=False)  # -> Points, Tangents, Parameters; disabled
construct_point_8 = ConstructPoint(XCoordinate=range, YCoordinate=expr("-X", expression_9), ZCoordinate=0)  # disabled
construct_point_9 = ConstructPoint(XCoordinate=range, YCoordinate=expression_9, ZCoordinate=0)  # disabled
construct_point_10 = ConstructPoint(XCoordinate=range_2, YCoordinate=0, ZCoordinate=0)  # disabled
deconstruct_arc_6 = DeconstructArc(Arc=list_item_6)  # -> BasePlane, Radius, Angle; disabled
geometry_39 = Geometry(circumscribed_polygon_2)
rotate_11 = Rotate(Geometry=geometry_39, Angle=degrees(30), Plane=PlaneXY(0, 0, 0))  # -> Geometry, Transform
fast_loop_end_10 = FastLoopEnd(
    port=fast_loop_start_10.port,
    Exit=False,
    Data=scale_65.Geometry,
    Data_2=brep_centroid_2,
    Data_3=brep_centroid_3,
    RecordData=True,
    TimeOutVal=0)  # -> Data, D1, D2; disabled
fast_loop_end_11 = FastLoopEnd(port=fast_loop_start_11.port, Exit=False, Data=scale_67.Geometry, RecordData=True, TimeOutVal=0)  # disabled
merge_23 = Merge(Data1=rotate_10.Geometry, Data2=fast_loop_end_11)  # -> flatten(Result); disabled
divide_curve_28 = DivideCurve(Curve=list_item_7, Count=6, Kinks=False)  # -> Points, Tangents, Parameters; disabled
interpolate = Interpolate(Vertices=construct_point_9, Degree=3, Periodic=False, KnotStyle=1)  # -> Curve, Length, Domain; disabled
deconstruct_arc_7 = DeconstructArc(Arc=list_item_7)  # -> BasePlane, Radius, Angle; disabled
offset_curve_5 = OffsetCurve(Curve=geometry_38, Plane=PlaneXY(0, 0, 0), Distance=division_37, BothSides=expr("-X", division_37), Kinks=1, CapType=3)
offset_curve_6 = OffsetCurve(
    Curve=scale_68.Geometry,
    Plane=PlaneXY(0, 0, 0),
    Distance=division_36,
    BothSides=expr("-X", division_36),
    Kinks=1,
    CapType=3)
interpolate_2 = Interpolate(Vertices=construct_point_8, Degree=3, Periodic=False, KnotStyle=1)  # -> Curve, Length, Domain; disabled
offset_curve_7 = OffsetCurve(
    Curve=scale_71.Geometry,
    Plane=PlaneXY(0, 0, 0),
    Distance=division_32,
    BothSides=expr("-X", division_32),
    Kinks=1,
    CapType=3)
list_item_8 = ListItem(List=cull_index_9, Index=1, Wrap=True)  # disabled
offset_curve_8 = OffsetCurve(
    Curve=scale_70.Geometry,
    Plane=PlaneXY(0, 0, 0),
    Distance=division_33,
    BothSides=expr("-X", division_33),
    Kinks=1,
    CapType=3)
merge_24 = Merge(Data1=deconstruct_arc_6.BasePlane, Data2=divide_curve_27.Points)  # disabled
offset_curve_9 = OffsetCurve(
    Curve=scale_69.Geometry,
    Plane=PlaneXY(0, 0, 0),
    Distance=division_35,
    BothSides=expr("-X", division_35),
    Kinks=1,
    CapType=3)
scale_72 = Scale(Geometry=scale_40.Geometry, Center=Point(0, 0, 0), Factor=1)  # -> Geometry, Transform
simple_mesh = SimpleMesh(Brep=flatten(rail_revolution))
line_6 = Line(StartPoint=fast_loop_end_10.D1, EndPoint=fast_loop_end_10.D2)  # disabled
cull_index_10 = CullIndex(List=divide_curve_28.Points, Indices=[2, 4], Wrap=False)  # disabled
scale_73 = Scale(Geometry=scale_40.Geometry, Center=Point(0, 0, 0), Factor=3)  # -> Geometry, Transform
simple_mesh_2 = SimpleMesh(Brep=flatten(rail_revolution_2))
divide_curve_29 = DivideCurve(Curve=list_item_8, Count=2, Kinks=False)  # -> Points, Tangents, Parameters; disabled
series_2 = Series(Start=0, Step=1, Count=5)  # -> graft(Series); disabled
point_10 = Point(merge_24)  # disabled
merge_25 = Merge(Data1=interpolate.Curve, Data2=interpolate_2.Curve)  # disabled
deconstruct_arc_8 = DeconstructArc(Arc=list_item_8)  # -> BasePlane, Radius, Angle; disabled
scale_74 = Scale(Geometry=list_item_6, Center=flatten(point_10), Factor=0.3333333333)  # -> Geometry, Transform; disabled
digit_scroller_15 = DigitScroller(Scroller_Digits=12, Scroller_Prefix="Digit Scroller", Scroller_Radix=11, Scroller_Value=1)  # disabled
stroke = Stroke(ShapeGeometry=merge_23, Color=RGBA(0, 244, 124, 0), Weight=0, EndCap=0)  # disabled
merge_26 = Merge(Data2=simple_mesh, Data3=boundary_surfaces_9)  # -> reverse(Result)
merge_27 = Merge(Data1=deconstruct_arc_7.BasePlane, Data2=cull_index_10)  # disabled
scale_75 = Scale(Geometry=list_item_7, Center=flatten(merge_27), Factor=0.3333333333)  # -> Geometry, Transform; disabled
polar_array_7 = PolarArray(Geometry=merge_25, Plane=PlaneXY(0, 0, 0), Count=6, Angle=6.283185307)  # -> Geometry, Transform; disabled
rotate_12 = Rotate(Geometry=polar_array_7.Geometry, Angle=degrees(90), Plane=PlaneXY(0, 0, 0))  # -> Geometry, Transform; disabled
scale_76 = Scale(Geometry=rotate_12.Geometry, Center=Point(0, 0, 0), Factor=0.1666666667)  # -> Geometry, Transform; disabled
center = Center(Geometry=scale_76.Geometry)  # -> Center, Dimension; disabled
fast_loop_start_12 = FastLoopStart(Iterations=digit_scroller_9, Data=scale_76.Geometry, D1=scale_76.Geometry, D2=center.Center)  # -> port, Counter, Data, Data_2, Data_3, Data_4; disabled
center_2 = Center(Geometry=fast_loop_start_12.Data, forall=False)  # -> Center, Dimension; disabled
trim_tree_2 = TrimTree(Tree=center_2.Center, Depth=fast_loop_start_12.Counter)  # disabled
scale_77 = Scale(Geometry=graft(fast_loop_start_12.Data), Center=flatten(merge_7), Factor=0.3333333333)  # -> Geometry, Transform; disabled
merge_28 = Merge(Data1=fast_loop_start_12.Data_2, Data2=scale_77.Geometry)  # disabled
center_3 = Center(Geometry=scale_77.Geometry, forall=False)  # -> Center, Dimension; disabled
fast_loop_end_12 = FastLoopEnd(
    port=fast_loop_start_12.port,
    Exit=False,
    Data=scale_77.Geometry,
    Data_2=merge_28,
    Data_3=center_2.Center,
    Data_4=center_3.Center,
    RecordData=True,
    TimeOutVal=0)  # -> Data, D1, D2, D3; disabled
stream_filter_20 = StreamFilter(Gate=number_slider_9, Stream0=fast_loop_end_12.Data, Stream1=fast_loop_end_12.D1)  # disabled
trim_tree_3 = TrimTree(Tree=center_3.Center, Depth=expr("X+1", fast_loop_start_12.Counter))  # disabled
geometry_40 = Geometry(stream_filter_20)  # disabled
stroke_2 = Stroke(ShapeGeometry=geometry_40, Color=RGBA(0, 244, 124, 0), Weight=0, EndCap=0)  # disabled
scale_78 = Scale(Geometry=fast_loop_end_12.Data, Center=Point(0, 0, 0), Factor=0.3333333333)  # -> Geometry, Transform; disabled
custom_preview_3 = CustomPreview(
    Geometry=geometry_40,
    Material={diffuse=RGB(221, 160, 221), emission=RGB(66, 48, 66), shine=0.5, specular=RGB(255, 255, 255), transparency=0})  # disabled
fast_loop_start_13 = FastLoopStart(Iterations=digit_scroller_12, Data=geometry_40)  # -> port, Counter, Data; disabled
line_7 = Line(StartPoint=fast_loop_end_12.D2, EndPoint=fast_loop_end_12.D3)  # disabled
scale_79 = Scale(Geometry=graft(fast_loop_start_13.Data), Center=flatten(Point(0, 0, 0)), Factor=0.3333333333)  # -> Geometry, Transform; disabled
center_4 = Center(Geometry=fast_loop_start_12.Data, forall=False)  # -> Center, Dimension; disabled
solid_fill = SolidFill(ShapeGeometry=stroke_2, Color=RGB(0, 244, 124))  # disabled
shape_data = ShapeData(ShapeGeometry=solid_fill, ID=" ", Hover=False)  # disabled
scale_80 = Scale(Geometry=graft(fast_loop_start_12.Data), Center=flatten(merge_7), Factor=0.3333333333)  # -> Geometry, Transform; disabled
construct_drawing = ConstructDrawing(
    ShapesGeometry=flatten(shape_data),
    Boundary=bounding_rectangle,
    Width=power_4,
    Height=power_4,
    Color=RGBA(255, 255, 255, 0))  # -> Drawing, Boundary; disabled
drawing_viewer = DrawingViewer(DrawingsShapesGeometry=construct_drawing.Drawing, Resolution=96)  # disabled
save_svg = SaveSvg(DrawingsShapesGeometry=flatten(construct_drawing.Drawing), FolderPath="C:\", FileName="ϱvƨ", Save=button_2)  # disabled
fast_loop_end_13 = FastLoopEnd(port=fast_loop_start_13.port, Exit=False, Data=scale_79.Geometry, RecordData=True, TimeOutVal=0)  # disabled
center_5 = Center(Geometry=scale_80.Geometry, forall=False)  # -> Center, Dimension; disabled
line_8 = Line(StartPoint=center_4.Center, EndPoint=center_5.Center)  # disabled
scale_81 = Scale(Geometry=graft(scale_80.Geometry), Center=flatten(merge_7), Factor=0.3333333333)  # -> Geometry, Transform; disabled
polyline = PolyLine(Vertices=center_5.Center, Closed=True)  # disabled
center_6 = Center(Geometry=scale_81.Geometry, forall=False)  # -> Center, Dimension; disabled
line_9 = Line(StartPoint=center_5.Center, EndPoint=center_6.Center)  # disabled
trim_tree_4 = TrimTree(Tree=center_6.Center, Depth=1)  # disabled
scale_82 = Scale(Geometry=graft(scale_81.Geometry), Center=flatten(merge_7), Factor=0.3333333333)  # -> Geometry, Transform; disabled
merge_29 = Merge(Data1=deconstruct_arc_8.BasePlane, Data2=divide_curve_29.Points)  # disabled
merge_30 = Merge(
    Data1=scale_72.Geometry,
    Data2=offset_curve_7,
    Data3=offset_curve_5,
    Data4=offset_curve_6,
    Data5=offset_curve_9,
    Data6=offset_curve_8)
polyline_2 = PolyLine(Vertices=center_6.Center, Closed=True)  # disabled
geometry_41 = Geometry(scale_40.Geometry)  # disabled
custom_preview_4 = CustomPreview(
    Geometry=merge_26,
    Material={diffuse=RGB(0, 244, 124), emission=RGB(0, 73, 37), shine=0.5, specular=RGB(255, 255, 255), transparency=0})
number = Number(series_2)  # disabled
addition_2 = Addition(A=number, B="0")  # disabled
negative_3 = Negative(Value=addition_2)  # disabled
boundary_surfaces_12 = BoundarySurfaces(Edges=merge_30)
merge_31 = Merge(Data1=simple_mesh_2, Data2=boundary_surfaces_12)
solid_fill_2 = SolidFill(ShapeGeometry=stroke, Color=RGB(0, 244, 124))  # disabled
shape_data_2 = ShapeData(ShapeGeometry=solid_fill_2, ID=" ", Hover=False)  # disabled
custom_preview_5 = CustomPreview(
    Geometry=[merge_31, merge_26],
    Material={diffuse=RGB(153, 153, 153), emission=RGB(46, 46, 46), shine=0.5, specular=RGB(255, 255, 255), transparency=0})
weaverbird_s_catmull_clark_subdivision = WeaverbirdsCatmullClarkSubdivision(Level=1, SmoothNakedEdges=1)  # disabled
point_11 = Point(merge_29)  # disabled
panel_16 = Panel("SQRT(3)/2")  # disabled
scale_83 = Scale(Geometry=list_item_8, Center=flatten(point_11), Factor=0.3333333333)  # -> Geometry, Transform; disabled
true_only_button_2 = TrueOnlyButton(LastSaveLocalization="neutral,N")  # disabled
power_5 = Power(A="3", B=negative_3)  # disabled
brep_wireframe = BrepWireframe(Brep=rail_revolution_2, Density=-1)
end_points = EndPoints(Curve=polar_array_7.Geometry)  # -> Start, End; disabled
scale_84 = Scale(Geometry=polar_array_7.Geometry, Center=end_points.End, Factor=1)  # -> Geometry, Transform; disabled
multiple_curves = MultipleCurves(Curves=flatten(scale_84.Geometry))  # -> Points, IndexA, IndexB, ParamA, ParamB; disabled
collision_many_many = CollisionManyMany(Colliders=flatten(scale_84.Geometry))  # -> Collision, Indices; disabled
power_6 = Power(A="3", B=number)  # disabled
multiplication_22 = Multiplication(A=power_6, B="1")  # disabled
merge_32 = Merge(Data1=merge_26, Data2=merge_31)  # disabled
stroke_3 = Stroke(ShapeGeometry=flatten(merge_31), Color=RGB(0, 0, 0), Weight=0, EndCap=0)  # disabled
center_7 = Center(Geometry=scale_82.Geometry, forall=False)  # -> Center, Dimension; disabled
trim_tree_5 = TrimTree(Tree=center_7.Center, Depth=1)  # disabled
line_10 = Line(StartPoint=trim_tree_4, EndPoint=trim_tree_5)  # disabled
trim_tree_6 = TrimTree(Tree=trim_tree_5, Depth=1)  # disabled
stroke_4 = Stroke(ShapeGeometry=flatten(merge_31), Color=RGB(0, 0, 0), Weight=0, EndCap=0)  # disabled
geometry_42 = Geometry(circumscribed_polygon_2)  # disabled
fast_loop_start_14 = FastLoopStart(Iterations=1, Data=geometry_42)  # -> port, Counter, Data; disabled
fast_loop_start_15 = FastLoopStart(Iterations=1, Data=geometry_42)  # -> port, Counter, Data; disabled
multiplication_23 = Multiplication(A=power_5, B=panel_16)  # disabled
quadrangulate = Quadrangulate(Mesh=rail_revolution_2, Angle=0.03490658504, Ratio=0.875)  # -> Mesh, Count; disabled
division_38 = Division(A=negative_3, B=panel_16)  # disabled
loop_start = LoopStart(Repeat=1, Trigger=true_only_button_2, Data=geometry_41)  # -> port, Counter, Data; disabled
scale_85 = Scale(Geometry=graft(geometry_41), Center=flatten(Point(0, 0, 0)), Factor=power_5)  # -> Geometry, Transform; disabled
area_3 = Area(Geometry=scale_85.Geometry)  # -> Area, Centroid; disabled
power_7 = Power(A="3", B=digit_scroller_14)  # disabled
construct_drawing_2 = ConstructDrawing(
    ShapesGeometry=flatten(shape_data_2),
    Boundary=bounding_rectangle,
    Width=power_7,
    Height=power_7,
    Color=RGBA(255, 255, 255, 0))  # -> Drawing, Boundary; disabled
drawing_viewer_2 = DrawingViewer(DrawingsShapesGeometry=construct_drawing_2.Drawing, Resolution=96)  # disabled
save_svg_2 = SaveSvg(DrawingsShapesGeometry=flatten(construct_drawing_2.Drawing), FolderPath="C:\", FileName="ϱvƨ", Save=button)  # disabled
tri_fan_polyline_2 = TriFanPolyline(Polyline=geometry_42)  # disabled
weaverbird_s_split_triangles_subdivision_5 = WeaverbirdsSplitTrianglesSubdivision(MeshCurves=tri_fan_polyline_2, Level=multiplication_22)  # disabled
polar_array_8 = PolarArray(Geometry=scale_74.Geometry, Plane=PlaneXY(0, 0, 0), Count=6, Angle=6.283185307)  # -> Geometry, Transform; disabled
bounding_rectangle_2 = BoundingRectangle(Content=geometry_39, Plane=PlaneXY(0, 0, 0))
polar_array_9 = PolarArray(Geometry=scale_83.Geometry, Plane=PlaneXY(0, 0, 0), Count=6, Angle=6.283185307)  # -> Geometry, Transform; disabled
rectangle_2pt_2 = Rectangle2Pt(Plane=PlaneXY(0, 0, 0), PointA=Point(0.5, 0.5, 0), PointB=Point(-0.5, -0.5, 0), Radius=0)  # -> Rectangle, Length
solid_fill_3 = SolidFill(ShapeGeometry=stroke_3, Color=RGB(209, 209, 209))  # disabled
polyline_3 = PolyLine(Vertices=center_7.Center, Closed=True)  # disabled
geometry_43 = Geometry(polyline_3)  # disabled
merge_33 = Merge(Data1=line_8, Data2=line_9, Data3=line_10, Data5=geometry_43)  # disabled
ggcurvessplitintersect = GgCurvesSplitIntersect(Curves=flatten(merge_33), Tol=7.629394531e-06, SplitPoly=True)  # -> flatten(Curves); disabled
multipipe = MultiPipe(
    Curves=flatten(ggcurvessplitintersect),
    NodeSize=0.0004572477,
    EndOffset=0,
    StrutSize=1,
    Segment=0,
    KinkAngle=0,
    CubeFit=0,
    Caps=1)  # disabled
custom_preview_6 = CustomPreview(
    Geometry=multipipe,
    Material={diffuse=RGB(176, 176, 176), emission=RGB(53, 53, 53), shine=0.5, specular=RGB(255, 255, 255), transparency=0})  # disabled
curve_direction = CurveDirection(Curve=merge_33)  # disabled
divide_curve_30 = DivideCurve(Curve=geometry_42, Count=12, Kinks=False)  # -> Points, Tangents, Parameters; disabled
solid_fill_4 = SolidFill(ShapeGeometry=stroke_4, Color=RGB(235, 235, 235))  # disabled
divide_curve_31 = DivideCurve(Curve=geometry_42, Count=6, Kinks=False)  # -> Points, Tangents, Parameters; disabled
scale_86 = Scale(Geometry=graft(fast_loop_start_15.Data), Center=flatten(divide_curve_31.Points), Factor=0.3333333333)  # -> Geometry, Transform; disabled
face_boundaries_5 = FaceBoundaries(Mesh=weaverbird_s_split_triangles_subdivision_5)  # disabled
face_normals = FaceNormals(Mesh=weaverbird_s_split_triangles_subdivision_5)  # -> Centers, Normals; disabled
stroke_5 = Stroke(ShapeGeometry=flatten(circle_2), Color=RGB(0, 244, 124), Weight=0, EndCap=0)
deconstruct_mesh = DeconstructMesh(Mesh=weaverbird_s_split_triangles_subdivision_5)  # -> Vertices, Faces, Colours, Normals; disabled
scale_87 = Scale(Geometry=graft(scale_82.Geometry), Center=flatten(merge_7), Factor=0.3333333333)  # -> Geometry, Transform; disabled
point_12 = Point(Point(-0.166666, 0.288, 0))  # disabled
deconstuct_rectangle = DeconstuctRectangle(Rectangle=bounding_rectangle_2)  # -> BasePlane, XInterval, YInterval
cull_nth_plus_15 = CullNthPlus(List=divide_curve_30.Points, CullFrequency=2)  # -> RemainList, RemoveList; disabled
center_8 = Center(Geometry=scale_87.Geometry, forall=False)  # -> Center, Dimension; disabled
fast_loop_end_14 = FastLoopEnd(port=fast_loop_start_15.port, Exit=False, Data=scale_86.Geometry, RecordData=False, TimeOutVal=0)  # disabled
trim_tree_7 = TrimTree(Tree=center_8.Center, Depth=1)  # disabled
trim_tree_8 = TrimTree(Tree=trim_tree_7, Depth=1)  # disabled
line_11 = Line(StartPoint=trim_tree_6, EndPoint=trim_tree_8)  # disabled
trim_tree_9 = TrimTree(Tree=trim_tree_8, Depth=1)  # disabled
point_13 = Point(Point(0, 0, 0))  # disabled
power_8 = Power(A="3", B="6")
cull_index_11 = CullIndex(List=polar_array_8.Geometry, Indices=[2, 4], Wrap=False)  # disabled
cull_duplicates = CullDuplicates(Points=deconstruct_mesh.Vertices, Tolerance=7.629394531e-06, CullMode=1)  # -> Points, Indices, Valence; disabled
orient_4 = Orient(Geometry=scale_85.Geometry, Source=area_3.Centroid, Target=deconstruct_mesh.Vertices)  # -> Geometry, Transform; disabled
cull_index_12 = CullIndex(List=polar_array_9.Geometry, Indices=[2, 4], Wrap=False)  # disabled
span_of_1d_domain = SpanOf1dDomain(Domain=deconstuct_rectangle.XInterval, Signed=True)
span_of_1d_domain_2 = SpanOf1dDomain(Domain=deconstuct_rectangle.YInterval, Signed=True)
explode_tree = ExplodeTree(Data=orient_4.Geometry)  # -> Branch0, Branch1, Branch2, Branch3, Branch4; disabled
geometry_44 = Geometry(cull_nth_plus_15.RemainList)  # disabled
scale_88 = Scale(Geometry=fast_loop_start_14.Data, Center=flatten(geometry_44), Factor=0.3333333333)  # -> Geometry, Transform; disabled
merge_34 = Merge(Data2=geometry_44)  # disabled
scale_89 = Scale(Geometry=graft(loop_start.Data), Center=flatten(merge_34), Factor=0.3333333333)  # -> Geometry, Transform; disabled
fast_loop_end_15 = FastLoopEnd(port=fast_loop_start_14.port, Exit=False, Data=scale_88.Geometry, RecordData=True, TimeOutVal=0)  # disabled
loop_end = LoopEnd(port=loop_start.port, Exit=False, Data=scale_89.Geometry, TimeOutVal=0, pausedState=False, state="Last & Record")  # disabled
move_3 = Move(Geometry=orient_4.Geometry, Motion=point_12)  # -> Geometry, Transform; disabled
true_only_button_3 = TrueOnlyButton(LastSaveLocalization="neutral,N")
division_39 = Division(A=span_of_1d_domain_2, B=span_of_1d_domain)
multiplication_24 = Multiplication(A=division_39, B=power_8)
polyline_4 = PolyLine(Vertices=center_8.Center, Closed=True)  # disabled
geometry_45 = Geometry(explode_tree.Branch0)  # disabled
collision_many_many_2 = CollisionManyMany(Colliders=flatten(orient_4.Geometry))  # -> Collision, Indices; disabled
scale_90 = Scale(Geometry=graft(scale_87.Geometry), Center=flatten(merge_7), Factor=0.3333333333)  # -> Geometry, Transform; disabled
cull_pattern_3 = CullPattern(List=flatten(orient_4.Geometry), CullPattern=invert(flatten(collision_many_many_2.Collision)))  # disabled
collision_one_many = CollisionOneMany(Collider=geometry_45, Obstacles=geometry_42)  # -> Collision, Index; disabled
geometry_46 = Geometry(explode_tree.Branch1)  # disabled
geometry_47 = Geometry(explode_tree.Branch2)  # disabled
geometry_48 = Geometry(explode_tree.Branch3)  # disabled
center_9 = Center(Geometry=scale_90.Geometry, forall=False)  # -> Center, Dimension; disabled
trim_tree_10 = TrimTree(Tree=center_9.Center, Depth=1)  # disabled
trim_tree_11 = TrimTree(Tree=trim_tree_10, Depth=1)  # disabled
trim_tree_12 = TrimTree(Tree=trim_tree_11, Depth=1)  # disabled
line_12 = Line(StartPoint=trim_tree_9, EndPoint=trim_tree_12)  # disabled
trim_tree_13 = TrimTree(Tree=trim_tree_12, Depth=1)  # disabled
geometry_49 = Geometry(explode_tree.Branch4)  # disabled
cull_pattern_4 = CullPattern(List=flatten(geometry_45), CullPattern=invert(flatten(collision_one_many.Collision)))  # disabled
merge_35 = Merge(Data1=geometry_42, Data2=cull_pattern_4)  # disabled
collision_one_many_2 = CollisionOneMany(Collider=geometry_46, Obstacles=merge_35)  # -> Collision, Index; disabled
cull_pattern_5 = CullPattern(List=flatten(geometry_46), CullPattern=invert(flatten(collision_one_many_2.Collision)))  # disabled
panel_17 = Panel(collision_many_many_2.Collision)  # disabled
merge_36 = Merge(Data1=cull_pattern_4, Data2=cull_pattern_5)  # disabled
merge_37 = Merge(Data1=geometry_42, Data2=merge_36)  # disabled
collision_one_many_3 = CollisionOneMany(Collider=geometry_47, Obstacles=merge_37)  # -> Collision, Index; disabled
cull_pattern_6 = CullPattern(List=flatten(geometry_47), CullPattern=invert(flatten(collision_one_many_3.Collision)))  # disabled
scale_91 = Scale(Geometry=graft(scale_90.Geometry), Center=flatten(merge_7), Factor=0.3333333333)  # -> Geometry, Transform; disabled
merge_38 = Merge(Data1=merge_36, Data2=cull_pattern_6)  # disabled
merge_39 = Merge(Data1=geometry_42, Data2=merge_38)  # disabled
collision_one_many_4 = CollisionOneMany(Collider=geometry_48, Obstacles=merge_39)  # -> Collision, Index; disabled
cull_pattern_7 = CullPattern(List=flatten(geometry_48), CullPattern=invert(flatten(collision_one_many_4.Collision)))  # disabled
center_10 = Center(Geometry=scale_91.Geometry, forall=False)  # -> Center, Dimension; disabled
merge_40 = Merge(Data1=merge_38, Data2=cull_pattern_7)  # disabled
region_union = RegionUnion(Curves=merge_40)  # disabled
merge_41 = Merge(Data1=geometry_42, Data2=region_union)  # -> flatten(Result); disabled
collision_one_many_5 = CollisionOneMany(Collider=geometry_49, Obstacles=merge_41)  # -> Collision, Index; disabled
cull_pattern_8 = CullPattern(List=flatten(geometry_49), CullPattern=invert(flatten(collision_one_many_5.Collision)))  # disabled
trim_tree_14 = TrimTree(Tree=center_10.Center, Depth=1)  # disabled
trim_tree_15 = TrimTree(Tree=trim_tree_14, Depth=1)  # disabled
trim_tree_16 = TrimTree(Tree=trim_tree_15, Depth=1)  # disabled
trim_tree_17 = TrimTree(Tree=trim_tree_16, Depth=1)  # disabled
line_13 = Line(StartPoint=trim_tree_13, EndPoint=trim_tree_17)  # disabled
merge_42 = Merge(Data1=merge_40, Data2=cull_pattern_8)  # disabled
stroke_6 = Stroke(ShapeGeometry=merge_42, Color=RGB(0, 244, 124), Weight=0, EndCap=0)  # disabled
solid_fill_5 = SolidFill(ShapeGeometry=stroke_6, Color=RGB(0, 244, 124))  # disabled
true_only_button_4 = TrueOnlyButton(LastSaveLocalization="neutral,N")  # disabled
geometry_50 = Geometry(circumscribed_polygon_2)  # disabled
scale_92 = Scale(Geometry=geometry_50, Center=Point(0, 0, 0), Factor=0.3333333333)  # -> Geometry, Transform; disabled
discontinuity_2 = Discontinuity(Curve=geometry_50, Level=1)  # -> Points, Parameters; disabled
loop_start_2 = LoopStart(Repeat=2, Trigger=true_only_button_4, Data=scale_92.Geometry)  # -> port, Counter, Data; disabled
scale_93 = Scale(Geometry=discontinuity_2.Points, Center=Point(0, 0, 0), Factor=0.75)  # -> Geometry, Transform; disabled
scale_94 = Scale(Geometry=graft(loop_start_2.Data), Center=scale_93.Geometry, Factor=0.1111111111)  # -> Geometry, Transform; disabled
loop_end_2 = LoopEnd(port=loop_start_2.port, Exit=False, Data=scale_94.Geometry, TimeOutVal=0, pausedState=False, state="Constant output")  # disabled
stroke_7 = Stroke(ShapeGeometry=loop_end_2, Color=RGB(0, 0, 0), Weight=0, EndCap=0)  # disabled
solid_fill_6 = SolidFill(ShapeGeometry=stroke_7, Color=RGB(0, 0, 0))  # disabled

panel_18 = Panel("SQRT(3)/2")  # disabled

scale_95 = Scale(Geometry=geometry_5, Center=Point(0, 0, 0), Factor=0.6666666667)  # -> Geometry, Transform
divide_curve_32 = DivideCurve(Curve=scale_95.Geometry, Count=multiplication_3, Kinks=True)  # -> Points, Tangents, Parameters
cull_nth_plus_16 = CullNthPlus(List=divide_curve_32.Points, CullFrequency=2)  # -> RemainList, RemoveList
scale_96 = Scale(Geometry=scale_95.Geometry, Center=Point(0, 0, 0), Factor=0.1666666667)  # -> Geometry, Transform
scale_97 = Scale(Geometry=scale_96.Geometry, Center=Point(0, 0, 0), Factor=0.3333333333)  # -> Geometry, Transform

scale_98 = Scale(Geometry=scale_97.Geometry, Center=Point(0, 0, 0), Factor=0.3333333333)  # -> Geometry, Transform
scale_99 = Scale(Geometry=scale_98.Geometry, Center=Point(0, 0, 0), Factor=0.3333333333)  # -> Geometry, Transform
scale_100 = Scale(Geometry=scale_98.Geometry, Center=Point(0, 0, 0), Factor=0.3333333333)  # -> Geometry, Transform
scale_101 = Scale(Geometry=scale_98.Geometry, Center=Point(0, 0, 0), Factor=0.3333333333)  # -> Geometry, Transform
scale_102 = Scale(Geometry=scale_98.Geometry, Center=Point(0, 0, 0), Factor=0.3333333333)  # -> Geometry, Transform
scale_103 = Scale(Geometry=scale_98.Geometry, Center=Point(0, 0, 0), Factor=0.3333333333)  # -> Geometry, Transform
scale_104 = Scale(Geometry=scale_98.Geometry, Center=Point(0, 0, 0), Factor=0.3333333333)  # -> Geometry, Transform
scale_105 = Scale(Geometry=scale_98.Geometry, Center=Point(0, 0, 0), Factor=0.3333333333)  # -> Geometry, Transform
scale_106 = Scale(Geometry=scale_97.Geometry, Center=Point(0, 0, 0), Factor=0.3333333333)  # -> Geometry, Transform
scale_107 = Scale(Geometry=scale_97.Geometry, Center=Point(0, 0, 0), Factor=0.3333333333)  # -> Geometry, Transform
scale_108 = Scale(Geometry=scale_98.Geometry, Center=Point(0, 0, 0), Factor=0.3333333333)  # -> Geometry, Transform
stream_filter_21 = StreamFilter(Gate=number_slider_6, Stream0=cull_nth_plus_16.RemainList, Stream1=cull_nth_plus_16.RemoveList)
scale_109 = Scale(Geometry=scale_97.Geometry, Center=Point(0, 0, 0), Factor=0.3333333333)  # -> Geometry, Transform
orient_5 = Orient(Geometry=scale_99.Geometry, Source=PlaneXY(0, 0, 0), Target=geometry_21)  # -> Geometry, Transform
geometry_51 = Geometry(orient_5.Geometry)
geometry_52 = Geometry(geometry_51)
list_item_9 = ListItem(List=geometry_52, Index=0, Wrap=True)
area_4 = Area(Geometry=list_item_9)  # -> Area, Centroid
scale_110 = Scale(Geometry=list_item_9, Center=area_4.Centroid, Factor=power)  # -> Geometry, Transform
geometry_53 = Geometry(scale_110.Geometry)
area_5 = Area(Geometry=geometry_53)  # -> Area, Centroid
rotate_13 = Rotate(Geometry=geometry_53, Angle=degrees(30), Plane=area_5.Centroid)  # -> Geometry, Transform
scale_111 = Scale(Geometry=rotate_13.Geometry, Center=area_5.Centroid, Factor="SQRT(3)/2")  # -> Geometry, Transform
orient_6 = Orient(Geometry=scale_97.Geometry, Source=PlaneXY(0, 0, 0), Target=geometry_19)  # -> Geometry, Transform
orient_7 = Orient(Geometry=scale_100.Geometry, Source=PlaneXY(0, 0, 0), Target=geometry_22)  # -> Geometry, Transform
orient_8 = Orient(Geometry=scale_97.Geometry, Source=PlaneXY(0, 0, 0), Target=geometry_23)  # -> Geometry, Transform
geometry_54 = Geometry(orient_8.Geometry)
geometry_55 = Geometry(geometry_54)
list_item_10 = ListItem(List=geometry_55, Index=0, Wrap=True)
area_6 = Area(Geometry=list_item_10)  # -> Area, Centroid
scale_112 = Scale(Geometry=list_item_10, Center=area_6.Centroid, Factor=power)  # -> Geometry, Transform
geometry_56 = Geometry(scale_112.Geometry)
area_7 = Area(Geometry=geometry_56)  # -> Area, Centroid

rotate_14 = Rotate(Geometry=geometry_56, Angle=degrees(30), Plane=area_7.Centroid)  # -> Geometry, Transform
scale_113 = Scale(Geometry=rotate_14.Geometry, Center=area_7.Centroid, Factor="SQRT(3)/2")  # -> Geometry, Transform
geometry_57 = Geometry(scale_113.Geometry)

stream_filter_22 = StreamFilter(Gate=number_slider_5, Stream0=geometry_56, Stream1=geometry_57)
geometry_58 = Geometry(stream_filter_22)
geometry_59 = Geometry(geometry_58)
center_11 = Center(Geometry=geometry_59)  # -> Center, Dimension
scale_114 = Scale(Geometry=geometry_59, Center=center_11.Center, Factor=expr("X*3", power))  # -> Geometry, Transform
area_8 = Area(Geometry=scale_114.Geometry)  # -> Area, Centroid
scale_115 = Scale(Geometry=geometry_58, Center=area_8.Centroid, Factor=stream_filter_2)  # -> Geometry, Transform
discontinuity_3 = Discontinuity(Curve=scale_115.Geometry, Level=1)  # -> Points, Parameters
orient_9 = Orient(Geometry=scale_101.Geometry, Source=PlaneXY(0, 0, 0), Target=geometry_24)  # -> Geometry, Transform
geometry_60 = Geometry(scale_111.Geometry)
orient_10 = Orient(Geometry=scale_102.Geometry, Source=PlaneXY(0, 0, 0), Target=geometry_25)  # -> Geometry, Transform
geometry_61 = Geometry(orient_10.Geometry)
geometry_62 = Geometry(geometry_61)
list_item_11 = ListItem(List=geometry_62, Index=0, Wrap=True)
area_9 = Area(Geometry=list_item_11)  # -> Area, Centroid
scale_116 = Scale(Geometry=list_item_11, Center=area_9.Centroid, Factor=power)  # -> Geometry, Transform
geometry_63 = Geometry(scale_116.Geometry)
area_10 = Area(Geometry=geometry_63)  # -> Area, Centroid
rotate_15 = Rotate(Geometry=geometry_63, Angle=degrees(30), Plane=area_10.Centroid)  # -> Geometry, Transform
scale_117 = Scale(Geometry=rotate_15.Geometry, Center=area_10.Centroid, Factor="SQRT(3)/2")  # -> Geometry, Transform
geometry_64 = Geometry(scale_117.Geometry)
stream_filter_23 = StreamFilter(Gate=number_slider_5, Stream0=geometry_63, Stream1=geometry_64)
geometry_65 = Geometry(stream_filter_23)
geometry_66 = Geometry(geometry_65)
center_12 = Center(Geometry=geometry_66)  # -> Center, Dimension
scale_118 = Scale(Geometry=geometry_66, Center=center_12.Center, Factor=expr("X*3", power))  # -> Geometry, Transform
area_11 = Area(Geometry=scale_118.Geometry)  # -> Area, Centroid
scale_119 = Scale(Geometry=geometry_65, Center=area_11.Centroid, Factor=stream_filter_2)  # -> Geometry, Transform
discontinuity_4 = Discontinuity(Curve=scale_119.Geometry, Level=1)  # -> Points, Parameters
orient_11 = Orient(Geometry=scale_98.Geometry, Source=PlaneXY(0, 0, 0), Target=geometry_27)  # -> Geometry, Transform
geometry_67 = Geometry(orient_11.Geometry)
geometry_68 = Geometry(geometry_67)
list_item_12 = ListItem(List=geometry_68, Index=0, Wrap=True)
area_12 = Area(Geometry=list_item_12)  # -> Area, Centroid
scale_120 = Scale(Geometry=list_item_12, Center=area_12.Centroid, Factor=power)  # -> Geometry, Transform
geometry_69 = Geometry(scale_120.Geometry)
area_13 = Area(Geometry=geometry_69)  # -> Area, Centroid

rotate_16 = Rotate(Geometry=geometry_69, Angle=degrees(30), Plane=area_13.Centroid)  # -> Geometry, Transform
scale_121 = Scale(Geometry=rotate_16.Geometry, Center=area_13.Centroid, Factor="SQRT(3)/2")  # -> Geometry, Transform
geometry_70 = Geometry(scale_121.Geometry)

stream_filter_24 = StreamFilter(Gate=number_slider_5, Stream0=geometry_69, Stream1=geometry_70)
geometry_71 = Geometry(stream_filter_24)
geometry_72 = Geometry(geometry_71)
orient_12 = Orient(Geometry=scale_104.Geometry, Source=PlaneXY(0, 0, 0), Target=geometry_26)  # -> Geometry, Transform
orient_13 = Orient(Geometry=scale_105.Geometry, Source=PlaneXY(0, 0, 0), Target=geometry_28)  # -> Geometry, Transform
orient_14 = Orient(Geometry=scale_103.Geometry, Source=PlaneXY(0, 0, 0), Target=geometry_29)  # -> Geometry, Transform
geometry_73 = Geometry(orient_14.Geometry)
geometry_74 = Geometry(geometry_73)
list_item_13 = ListItem(List=geometry_74, Index=0, Wrap=True)
area_14 = Area(Geometry=list_item_13)  # -> Area, Centroid
scale_122 = Scale(Geometry=list_item_13, Center=area_14.Centroid, Factor=power)  # -> Geometry, Transform
geometry_75 = Geometry(scale_122.Geometry)
area_15 = Area(Geometry=geometry_75)  # -> Area, Centroid
rotate_17 = Rotate(Geometry=geometry_75, Angle=degrees(30), Plane=area_15.Centroid)  # -> Geometry, Transform
scale_123 = Scale(Geometry=rotate_17.Geometry, Center=area_15.Centroid, Factor="SQRT(3)/2")  # -> Geometry, Transform
geometry_76 = Geometry(scale_123.Geometry)
stream_filter_25 = StreamFilter(Gate=number_slider_5, Stream0=geometry_75, Stream1=geometry_76)
geometry_77 = Geometry(stream_filter_25)
stream_filter_26 = StreamFilter(Gate=number_slider_5, Stream0=geometry_53, Stream1=geometry_60)
geometry_78 = Geometry(stream_filter_26)
geometry_79 = Geometry(orient_13.Geometry)
geometry_80 = Geometry(geometry_79)
list_item_14 = ListItem(List=geometry_80, Index=0, Wrap=True)
area_16 = Area(Geometry=list_item_14)  # -> Area, Centroid
scale_124 = Scale(Geometry=list_item_14, Center=area_16.Centroid, Factor=power)  # -> Geometry, Transform
geometry_81 = Geometry(scale_124.Geometry)
area_17 = Area(Geometry=geometry_81)  # -> Area, Centroid
rotate_18 = Rotate(Geometry=geometry_81, Angle=degrees(30), Plane=area_17.Centroid)  # -> Geometry, Transform
scale_125 = Scale(Geometry=rotate_18.Geometry, Center=area_17.Centroid, Factor="SQRT(3)/2")  # -> Geometry, Transform
geometry_82 = Geometry(scale_125.Geometry)
stream_filter_27 = StreamFilter(Gate=number_slider_5, Stream0=geometry_81, Stream1=geometry_82)
geometry_83 = Geometry(stream_filter_27)
geometry_84 = Geometry(geometry_83)
fast_loop_start_16 = FastLoopStart(Iterations=subtraction_3, Data=scale_114.Geometry)  # -> port, Counter, Data
center_13 = Center(Geometry=geometry_72)  # -> Center, Dimension
scale_126 = Scale(Geometry=geometry_72, Center=center_13.Center, Factor=expr("X*3", power))  # -> Geometry, Transform
area_18 = Area(Geometry=scale_126.Geometry)  # -> Area, Centroid
scale_127 = Scale(Geometry=geometry_71, Center=area_18.Centroid, Factor=3)  # -> Geometry, Transform
discontinuity_5 = Discontinuity(Curve=scale_127.Geometry, Level=1)  # -> Points, Parameters
fast_loop_start_17 = FastLoopStart(Iterations=subtraction, Data=scale_126.Geometry)  # -> port, Counter, Data
fast_loop_start_18 = FastLoopStart(Iterations=subtraction_4, Data=scale_118.Geometry)  # -> port, Counter, Data
center_14 = Center(Geometry=geometry_84)  # -> Center, Dimension
scale_128 = Scale(Geometry=geometry_84, Center=center_14.Center, Factor=expr("X*3", power))  # -> Geometry, Transform
area_19 = Area(Geometry=scale_128.Geometry)  # -> Area, Centroid
scale_129 = Scale(Geometry=geometry_83, Center=area_19.Centroid, Factor=stream_filter_2)  # -> Geometry, Transform
discontinuity_6 = Discontinuity(Curve=scale_129.Geometry, Level=1)  # -> Points, Parameters
fast_loop_start_19 = FastLoopStart(Iterations=subtraction_2, Data=scale_128.Geometry)  # -> port, Counter, Data
orient_15 = Orient(Geometry=scale_106.Geometry, Source=PlaneXY(0, 0, 0), Target=geometry_30)  # -> Geometry, Transform
geometry_85 = Geometry(orient_15.Geometry)
geometry_86 = Geometry(geometry_85)
list_item_15 = ListItem(List=geometry_86, Index=0, Wrap=True)
area_20 = Area(Geometry=list_item_15)  # -> Area, Centroid
scale_130 = Scale(Geometry=list_item_15, Center=area_20.Centroid, Factor=power)  # -> Geometry, Transform
geometry_87 = Geometry(scale_130.Geometry)
area_21 = Area(Geometry=geometry_87)  # -> Area, Centroid

rotate_19 = Rotate(Geometry=geometry_87, Angle=degrees(30), Plane=area_21.Centroid)  # -> Geometry, Transform
scale_131 = Scale(Geometry=rotate_19.Geometry, Center=area_21.Centroid, Factor="SQRT(3)/2")  # -> Geometry, Transform
geometry_88 = Geometry(scale_131.Geometry)

orient_16 = Orient(Geometry=scale_107.Geometry, Source=PlaneXY(0, 0, 0), Target=geometry_31)  # -> Geometry, Transform
geometry_89 = Geometry(orient_16.Geometry)
geometry_90 = Geometry(geometry_89)
list_item_16 = ListItem(List=geometry_90, Index=0, Wrap=True)
area_22 = Area(Geometry=list_item_16)  # -> Area, Centroid
scale_132 = Scale(Geometry=list_item_16, Center=area_22.Centroid, Factor=power)  # -> Geometry, Transform
geometry_91 = Geometry(orient_6.Geometry)
geometry_92 = Geometry(geometry_91)
list_item_17 = ListItem(List=geometry_92, Index=0, Wrap=True)
area_23 = Area(Geometry=list_item_17)  # -> Area, Centroid
scale_133 = Scale(Geometry=list_item_17, Center=area_23.Centroid, Factor=power)  # -> Geometry, Transform
geometry_93 = Geometry(scale_133.Geometry)
area_24 = Area(Geometry=geometry_93)  # -> Area, Centroid

rotate_20 = Rotate(Geometry=geometry_93, Angle=degrees(30), Plane=area_24.Centroid)  # -> Geometry, Transform
scale_134 = Scale(Geometry=rotate_20.Geometry, Center=area_24.Centroid, Factor="SQRT(3)/2")  # -> Geometry, Transform
geometry_94 = Geometry(scale_134.Geometry)

stream_filter_28 = StreamFilter(Gate=number_slider_5, Stream0=geometry_93, Stream1=geometry_94)
geometry_95 = Geometry(stream_filter_28)
orient_17 = Orient(Geometry=scale_108.Geometry, Source=PlaneXY(0, 0, 0), Target=geometry_33)  # -> Geometry, Transform
stream_filter_29 = StreamFilter(Gate=number_slider_5, Stream0=geometry_87, Stream1=geometry_88)
geometry_96 = Geometry(stream_filter_29)
orient_18 = Orient(Geometry=scale_109.Geometry, Source=PlaneXY(0, 0, 0), Target=geometry_32)  # -> Geometry, Transform
scale_135 = Scale(Geometry=graft(fast_loop_start_17.Data), Center=discontinuity_5.Points, Factor=0.3333333333)  # -> Geometry, Transform
geometry_97 = Geometry(geometry_77)
geometry_98 = Geometry(geometry_78)
tri_fan_polyline_3 = TriFanPolyline(Polyline=orient_5.Geometry)  # -> flatten(Polylines); disabled
geometry_99 = Geometry(orient_18.Geometry)
geometry_100 = Geometry(geometry_99)
list_item_18 = ListItem(List=geometry_100, Index=0, Wrap=True)
area_25 = Area(Geometry=list_item_18)  # -> Area, Centroid
scale_136 = Scale(Geometry=list_item_18, Center=area_25.Centroid, Factor=power)  # -> Geometry, Transform
geometry_101 = Geometry(scale_136.Geometry)
area_26 = Area(Geometry=geometry_101)  # -> Area, Centroid

rotate_21 = Rotate(Geometry=geometry_101, Angle=degrees(30), Plane=area_26.Centroid)  # -> Geometry, Transform
scale_137 = Scale(Geometry=rotate_21.Geometry, Center=area_26.Centroid, Factor="SQRT(3)/2")  # -> Geometry, Transform
geometry_102 = Geometry(scale_137.Geometry)

stream_filter_30 = StreamFilter(Gate=number_slider_5, Stream0=geometry_101, Stream1=geometry_102)
geometry_103 = Geometry(stream_filter_30)
geometry_104 = Geometry(geometry_103)
center_15 = Center(Geometry=geometry_104)  # -> Center, Dimension
scale_138 = Scale(Geometry=geometry_104, Center=center_15.Center, Factor=expr("X*3", power))  # -> Geometry, Transform
area_27 = Area(Geometry=scale_138.Geometry)  # -> Area, Centroid
scale_139 = Scale(Geometry=geometry_103, Center=area_27.Centroid, Factor=stream_filter_2)  # -> Geometry, Transform
discontinuity_7 = Discontinuity(Curve=scale_139.Geometry, Level=1)  # -> Points, Parameters
fast_loop_start_20 = FastLoopStart(Iterations=subtraction_6, Data=scale_138.Geometry)  # -> port, Counter, Data
scale_140 = Scale(Geometry=graft(fast_loop_start_19.Data), Center=discontinuity_6.Points, Factor=stream_filter)  # -> Geometry, Transform
tri_fan_polyline_4 = TriFanPolyline(Polyline=orient_6.Geometry)  # -> flatten(Polylines); disabled
geometry_105 = Geometry(geometry_95)
geometry_106 = Geometry(scale_132.Geometry)
area_28 = Area(Geometry=geometry_106)  # -> Area, Centroid
rotate_22 = Rotate(Geometry=geometry_106, Angle=degrees(30), Plane=area_28.Centroid)  # -> Geometry, Transform
scale_141 = Scale(Geometry=rotate_22.Geometry, Center=area_28.Centroid, Factor="SQRT(3)/2")  # -> Geometry, Transform
geometry_107 = Geometry(scale_141.Geometry)
geometry_108 = Geometry(orient_9.Geometry)
geometry_109 = Geometry(geometry_108)
list_item_19 = ListItem(List=geometry_109, Index=0, Wrap=True)
area_29 = Area(Geometry=list_item_19)  # -> Area, Centroid
scale_142 = Scale(Geometry=list_item_19, Center=area_29.Centroid, Factor=power)  # -> Geometry, Transform
geometry_110 = Geometry(scale_142.Geometry)
area_30 = Area(Geometry=geometry_110)  # -> Area, Centroid
rotate_23 = Rotate(Geometry=geometry_110, Angle=degrees(30), Plane=area_30.Centroid)  # -> Geometry, Transform
scale_143 = Scale(Geometry=rotate_23.Geometry, Center=area_30.Centroid, Factor="SQRT(3)/2")  # -> Geometry, Transform
geometry_111 = Geometry(scale_143.Geometry)
stream_filter_31 = StreamFilter(Gate=number_slider_5, Stream0=geometry_110, Stream1=geometry_111)
geometry_112 = Geometry(stream_filter_31)
tri_fan_polyline_5 = TriFanPolyline(Polyline=orient_7.Geometry)  # -> flatten(Polylines); disabled
area_31 = Area(Geometry=geometry_67)  # -> Area, Centroid
geometry_113 = Geometry(geometry_96)
center_16 = Center(Geometry=geometry_97)  # -> Center, Dimension
scale_144 = Scale(Geometry=geometry_97, Center=center_16.Center, Factor=expr("X*3", power))  # -> Geometry, Transform
area_32 = Area(Geometry=scale_144.Geometry)  # -> Area, Centroid
scale_145 = Scale(Geometry=geometry_77, Center=area_32.Centroid, Factor=stream_filter_2)  # -> Geometry, Transform
discontinuity_8 = Discontinuity(Curve=scale_145.Geometry, Level=1)  # -> Points, Parameters
fast_loop_start_21 = FastLoopStart(Iterations=subtraction_5, Data=scale_144.Geometry)  # -> port, Counter, Data
tri_fan_polyline_6 = TriFanPolyline(Polyline=orient_8.Geometry)  # -> flatten(Polylines); disabled
center_17 = Center(Geometry=geometry_79)  # -> Center, Dimension
center_18 = Center(Geometry=geometry_98)  # -> Center, Dimension
scale_146 = Scale(Geometry=geometry_98, Center=center_18.Center, Factor=expr("X*3", power))  # -> Geometry, Transform
area_33 = Area(Geometry=scale_146.Geometry)  # -> Area, Centroid
scale_147 = Scale(Geometry=geometry_78, Center=area_33.Centroid, Factor=stream_filter_2)  # -> Geometry, Transform
discontinuity_9 = Discontinuity(Curve=scale_147.Geometry, Level=1)  # -> Points, Parameters
fast_loop_start_22 = FastLoopStart(Iterations=subtraction_7, Data=scale_146.Geometry)  # -> port, Counter, Data
area_34 = Area(Geometry=geometry_79)  # -> Area, Centroid; disabled
geometry_114 = Geometry(orient_17.Geometry)
geometry_115 = Geometry(geometry_114)
list_item_20 = ListItem(List=geometry_115, Index=0, Wrap=True)
area_35 = Area(Geometry=list_item_20)  # -> Area, Centroid
scale_148 = Scale(Geometry=list_item_20, Center=area_35.Centroid, Factor=power)  # -> Geometry, Transform
geometry_116 = Geometry(scale_148.Geometry)
area_36 = Area(Geometry=geometry_116)  # -> Area, Centroid
rotate_24 = Rotate(Geometry=geometry_116, Angle=degrees(30), Plane=area_36.Centroid)  # -> Geometry, Transform
scale_149 = Scale(Geometry=rotate_24.Geometry, Center=area_36.Centroid, Factor="SQRT(3)/2")  # -> Geometry, Transform
geometry_117 = Geometry(scale_149.Geometry)
stream_filter_32 = StreamFilter(Gate=number_slider_5, Stream0=geometry_116, Stream1=geometry_117)
geometry_118 = Geometry(stream_filter_32)
tri_fan_polyline_7 = TriFanPolyline(Polyline=orient_9.Geometry)  # -> flatten(Polylines); disabled
scale_150 = Scale(Geometry=graft(fast_loop_start_16.Data), Center=discontinuity_3.Points, Factor=stream_filter)  # -> Geometry, Transform
scale_151 = Scale(Geometry=graft(fast_loop_start_18.Data), Center=discontinuity_4.Points, Factor=stream_filter)  # -> Geometry, Transform
tri_fan_polyline_8 = TriFanPolyline(Polyline=orient_10.Geometry)  # -> flatten(Polylines); disabled
geometry_119 = Geometry(geometry_112)
tri_fan_polyline_9 = TriFanPolyline(Polyline=orient_11.Geometry)  # -> flatten(Polylines); disabled
tri_fan_polyline_10 = TriFanPolyline(Polyline=orient_12.Geometry)  # -> flatten(Polylines); disabled
center_19 = Center(Geometry=geometry_105)  # -> Center, Dimension
scale_152 = Scale(Geometry=geometry_105, Center=center_19.Center, Factor=expr("X*3", power))  # -> Geometry, Transform
area_37 = Area(Geometry=scale_152.Geometry)  # -> Area, Centroid
scale_153 = Scale(Geometry=geometry_95, Center=area_37.Centroid, Factor=stream_filter_2)  # -> Geometry, Transform
discontinuity_10 = Discontinuity(Curve=scale_153.Geometry, Level=1)  # -> Points, Parameters
fast_loop_start_23 = FastLoopStart(Iterations=subtraction_8, Data=scale_152.Geometry)  # -> port, Counter, Data
tri_fan_polyline_11 = TriFanPolyline(Polyline=orient_13.Geometry)  # -> flatten(Polylines); disabled
geometry_120 = Geometry(geometry_118)
tri_fan_polyline_12 = TriFanPolyline(Polyline=orient_14.Geometry)  # -> flatten(Polylines); disabled
area_38 = Area(Geometry=geometry_54)  # -> Area, Centroid
area_39 = Area(Geometry=geometry_61)  # -> Area, Centroid
center_20 = Center(Geometry=geometry_113)  # -> Center, Dimension
scale_154 = Scale(Geometry=geometry_113, Center=center_20.Center, Factor=expr("X*3", power))  # -> Geometry, Transform
area_40 = Area(Geometry=scale_154.Geometry)  # -> Area, Centroid
scale_155 = Scale(Geometry=geometry_96, Center=area_40.Centroid, Factor=stream_filter_2)  # -> Geometry, Transform
discontinuity_11 = Discontinuity(Curve=scale_155.Geometry, Level=1)  # -> Points, Parameters
fast_loop_start_24 = FastLoopStart(Iterations=subtraction_9, Data=scale_154.Geometry)  # -> port, Counter, Data
tri_fan_polyline_13 = TriFanPolyline(Polyline=orient_15.Geometry)  # -> flatten(Polylines); disabled
tri_fan_polyline_14 = TriFanPolyline(Polyline=orient_16.Geometry)  # -> flatten(Polylines); disabled
center_21 = Center(Geometry=geometry_119)  # -> Center, Dimension
scale_156 = Scale(Geometry=geometry_119, Center=center_21.Center, Factor=expr("X*3", power))  # -> Geometry, Transform
area_41 = Area(Geometry=scale_156.Geometry)  # -> Area, Centroid
scale_157 = Scale(Geometry=geometry_112, Center=area_41.Centroid, Factor=stream_filter_2)  # -> Geometry, Transform
discontinuity_12 = Discontinuity(Curve=scale_157.Geometry, Level=1)  # -> Points, Parameters
fast_loop_start_25 = FastLoopStart(Iterations=subtraction_10, Data=scale_156.Geometry)  # -> port, Counter, Data
tri_fan_polyline_15 = TriFanPolyline(Polyline=orient_17.Geometry)  # -> flatten(Polylines); disabled
explode_4 = Explode(Curve=tri_fan_polyline_3, Recursive=True)  # -> flatten(Segments), Vertices; disabled
tri_fan_polyline_16 = TriFanPolyline(Polyline=orient_18.Geometry)  # -> flatten(Polylines); disabled
scale_158 = Scale(Geometry=graft(fast_loop_start_22.Data), Center=discontinuity_9.Points, Factor=stream_filter)  # -> Geometry, Transform
list_item_21 = ListItem(List=area_31.Centroid, Index=0, Wrap=True)
scale_159 = Scale(Geometry=graft(fast_loop_start_21.Data), Center=discontinuity_8.Points, Factor=stream_filter)  # -> Geometry, Transform
explode_5 = Explode(Curve=tri_fan_polyline_4, Recursive=True)  # -> flatten(Segments), Vertices; disabled
scale_160 = Scale(Geometry=graft(fast_loop_start_20.Data), Center=discontinuity_7.Points, Factor=stream_filter)  # -> Geometry, Transform
stream_filter_33 = StreamFilter(Gate=number_slider_5, Stream0=geometry_106, Stream1=geometry_107)
geometry_121 = Geometry(stream_filter_33)
list_item_22 = ListItem(List=center_17.Center, Index=0, Wrap=True)
center_22 = Center(Geometry=geometry_120)  # -> Center, Dimension
scale_161 = Scale(Geometry=geometry_120, Center=center_22.Center, Factor=expr("X*3", power))  # -> Geometry, Transform
area_42 = Area(Geometry=scale_161.Geometry)  # -> Area, Centroid
scale_162 = Scale(Geometry=geometry_118, Center=area_42.Centroid, Factor=stream_filter_2)  # -> Geometry, Transform
discontinuity_13 = Discontinuity(Curve=scale_162.Geometry, Level=1)  # -> Points, Parameters
fast_loop_start_26 = FastLoopStart(Iterations=subtraction_11, Data=scale_161.Geometry)  # -> port, Counter, Data
explode_6 = Explode(Curve=tri_fan_polyline_5, Recursive=True)  # -> flatten(Segments), Vertices; disabled
geometry_122 = Geometry(orient_7.Geometry)
geometry_123 = Geometry(geometry_122)
list_item_23 = ListItem(List=geometry_123, Index=0, Wrap=True)
area_43 = Area(Geometry=list_item_23)  # -> Area, Centroid
scale_163 = Scale(Geometry=list_item_23, Center=area_43.Centroid, Factor=power)  # -> Geometry, Transform
geometry_124 = Geometry(scale_163.Geometry)
area_44 = Area(Geometry=geometry_124)  # -> Area, Centroid
rotate_25 = Rotate(Geometry=geometry_124, Angle=degrees(30), Plane=area_44.Centroid)  # -> Geometry, Transform
scale_164 = Scale(Geometry=rotate_25.Geometry, Center=area_44.Centroid, Factor="SQRT(3)/2")  # -> Geometry, Transform
geometry_125 = Geometry(scale_164.Geometry)
explode_7 = Explode(Curve=tri_fan_polyline_6, Recursive=True)  # -> flatten(Segments), Vertices; disabled
area_45 = Area(Geometry=geometry_51)  # -> Area, Centroid
stream_filter_34 = StreamFilter(Gate=number_slider_5, Stream0=geometry_124, Stream1=geometry_125)
geometry_126 = Geometry(stream_filter_34)
explode_8 = Explode(Curve=tri_fan_polyline_7, Recursive=True)  # -> flatten(Segments), Vertices; disabled
scale_165 = Scale(Geometry=graft(fast_loop_start_23.Data), Center=discontinuity_10.Points, Factor=stream_filter)  # -> Geometry, Transform
area_46 = Area(Geometry=geometry_73)  # -> Area, Centroid
area_47 = Area(Geometry=geometry_99)  # -> Area, Centroid
geometry_127 = Geometry(geometry_121)
explode_9 = Explode(Curve=tri_fan_polyline_8, Recursive=True)  # -> flatten(Segments), Vertices; disabled
explode_10 = Explode(Curve=tri_fan_polyline_9, Recursive=True)  # -> flatten(Segments), Vertices; disabled
list_item_24 = ListItem(List=area_38.Centroid, Index=0, Wrap=True)
list_item_25 = ListItem(List=area_39.Centroid, Index=0, Wrap=True)
explode_11 = Explode(Curve=tri_fan_polyline_10, Recursive=True)  # -> flatten(Segments), Vertices; disabled
fast_loop_end_16 = FastLoopEnd(port=fast_loop_start_17.port, Exit=False, Data=scale_135.Geometry, RecordData=False, TimeOutVal=0)
area_48 = Area(Geometry=geometry_91)  # -> Area, Centroid
scale_166 = Scale(Geometry=graft(fast_loop_start_24.Data), Center=discontinuity_11.Points, Factor=stream_filter)  # -> Geometry, Transform
explode_12 = Explode(Curve=tri_fan_polyline_11, Recursive=True)  # -> flatten(Segments), Vertices; disabled
explode_13 = Explode(Curve=tri_fan_polyline_12, Recursive=True)  # -> flatten(Segments), Vertices; disabled
fast_loop_end_17 = FastLoopEnd(port=fast_loop_start_19.port, Exit=False, Data=scale_140.Geometry, RecordData=False, TimeOutVal=0)
scale_167 = Scale(Geometry=graft(fast_loop_start_25.Data), Center=discontinuity_12.Points, Factor=stream_filter)  # -> Geometry, Transform
explode_14 = Explode(Curve=tri_fan_polyline_13, Recursive=True)  # -> flatten(Segments), Vertices; disabled
explode_15 = Explode(Curve=tri_fan_polyline_14, Recursive=True)  # -> flatten(Segments), Vertices; disabled
area_49 = Area(Geometry=geometry_85)  # -> Area, Centroid
center_23 = Center(Geometry=geometry_127)  # -> Center, Dimension
scale_168 = Scale(Geometry=geometry_127, Center=center_23.Center, Factor=expr("X*3", power))  # -> Geometry, Transform
area_50 = Area(Geometry=scale_168.Geometry)  # -> Area, Centroid
scale_169 = Scale(Geometry=geometry_121, Center=area_50.Centroid, Factor=stream_filter_2)  # -> Geometry, Transform
discontinuity_14 = Discontinuity(Curve=scale_169.Geometry, Level=1)  # -> Points, Parameters
explode_16 = Explode(Curve=tri_fan_polyline_15, Recursive=True)  # -> flatten(Segments), Vertices; disabled
area_51 = Area(Geometry=geometry_108)  # -> Area, Centroid
explode_17 = Explode(Curve=tri_fan_polyline_16, Recursive=True)  # -> flatten(Segments), Vertices; disabled
fast_loop_end_18 = FastLoopEnd(port=fast_loop_start_16.port, Exit=False, Data=scale_150.Geometry, RecordData=True, TimeOutVal=0)
fast_loop_start_27 = FastLoopStart(Iterations=subtraction_12, Data=scale_168.Geometry)  # -> port, Counter, Data
fast_loop_end_19 = FastLoopEnd(port=fast_loop_start_18.port, Exit=False, Data=scale_151.Geometry, RecordData=False, TimeOutVal=0)
scale_170 = Scale(Geometry=graft(fast_loop_start_26.Data), Center=discontinuity_13.Points, Factor=stream_filter)  # -> Geometry, Transform
list_item_26 = ListItem(List=area_45.Centroid, Index=0, Wrap=True)
ggnetworkpolygons = GgNetworkPolygons(Curves=explode_4.Segments, PerimOrVoid=3)  # disabled
geometry_128 = Geometry(geometry_126)
list_item_27 = ListItem(List=area_46.Centroid, Index=0, Wrap=True)
list_item_28 = ListItem(List=area_47.Centroid, Index=0, Wrap=True)
ggnetworkpolygons_2 = GgNetworkPolygons(Curves=explode_5.Segments, PerimOrVoid=3)  # disabled
merge_43 = Merge(Data1=scale_126.Geometry, Data2=fast_loop_end_16)
ggnetworkpolygons_3 = GgNetworkPolygons(Curves=explode_6.Segments, PerimOrVoid=3)  # disabled
area_52 = Area(Geometry=geometry_114)  # -> Area, Centroid
ggnetworkpolygons_4 = GgNetworkPolygons(Curves=explode_7.Segments, PerimOrVoid=3)  # disabled

geometry_129 = Geometry(stream_filter_21)
orient_19 = Orient(Geometry=scale_96.Geometry, Source=PlaneXY(0, 0, 0), Target=geometry_129)  # -> Geometry, Transform
tri_fan_polyline_17 = TriFanPolyline(Polyline=orient_19.Geometry)  # -> flatten(Polylines)
shift_list = ShiftList(List=orient_19.Geometry, Shift=-1, Wrap=True)
cull_nth_plus_17 = CullNthPlus(List=shift_list, CullFrequency=3)  # -> RemainList, RemoveList
explode_18 = Explode(Curve=tri_fan_polyline_17, Recursive=True)  # -> flatten(Segments), Vertices
ggnetworkpolygons_5 = GgNetworkPolygons(Curves=explode_18.Segments, PerimOrVoid=3)
weaverbird_s_split_triangles_subdivision_6 = WeaverbirdsSplitTrianglesSubdivision(MeshCurves=ggnetworkpolygons_5, Level=0)
face_boundaries_6 = FaceBoundaries(Mesh=weaverbird_s_split_triangles_subdivision_6)
merge_44 = Merge(Data1=face_boundaries_6, Data2=ggnetworkpolygons_2, Data3=ggnetworkpolygons_4)

weaverbird_s_split_triangles_subdivision_7 = WeaverbirdsSplitTrianglesSubdivision(MeshCurves=ggnetworkpolygons_5, Level=3)  # disabled
stream_filter_35 = StreamFilter(Gate=number_slider_4, Stream0=fast_loop_end_16, Stream1=merge_43)
list_item_29 = ListItem(List=area_48.Centroid, Index=0, Wrap=True)
merge_45 = Merge(Data1=scale_128.Geometry, Data2=fast_loop_end_17)
ggnetworkpolygons_6 = GgNetworkPolygons(Curves=explode_8.Segments, PerimOrVoid=3)  # disabled
geometry_130 = Geometry(orient_12.Geometry)
geometry_131 = Geometry(geometry_130)
list_item_30 = ListItem(List=geometry_131, Index=0, Wrap=True)
area_53 = Area(Geometry=list_item_30)  # -> Area, Centroid
scale_171 = Scale(Geometry=list_item_30, Center=area_53.Centroid, Factor=power)  # -> Geometry, Transform
geometry_132 = Geometry(scale_171.Geometry)
area_54 = Area(Geometry=geometry_132)  # -> Area, Centroid
rotate_26 = Rotate(Geometry=geometry_132, Angle=degrees(30), Plane=area_54.Centroid)  # -> Geometry, Transform
scale_172 = Scale(Geometry=rotate_26.Geometry, Center=area_54.Centroid, Factor="SQRT(3)/2")  # -> Geometry, Transform
geometry_133 = Geometry(scale_172.Geometry)
stream_filter_36 = StreamFilter(Gate=number_slider_5, Stream0=geometry_132, Stream1=geometry_133)
geometry_134 = Geometry(stream_filter_36)
stream_filter_37 = StreamFilter(Gate=number_slider_4, Stream0=fast_loop_end_17, Stream1=merge_45)
ggnetworkpolygons_7 = GgNetworkPolygons(Curves=explode_9.Segments, PerimOrVoid=3)  # disabled
fast_loop_end_20 = FastLoopEnd(port=fast_loop_start_22.port, Exit=False, Data=scale_158.Geometry, RecordData=False, TimeOutVal=0)
ggnetworkpolygons_8 = GgNetworkPolygons(Curves=explode_10.Segments, PerimOrVoid=3)  # disabled
center_24 = Center(Geometry=geometry_128)  # -> Center, Dimension
scale_173 = Scale(Geometry=geometry_128, Center=center_24.Center, Factor=expr("X*3", power))  # -> Geometry, Transform
area_55 = Area(Geometry=scale_173.Geometry)  # -> Area, Centroid
scale_174 = Scale(Geometry=geometry_126, Center=area_55.Centroid, Factor=stream_filter_2)  # -> Geometry, Transform
discontinuity_15 = Discontinuity(Curve=scale_174.Geometry, Level=1)  # -> Points, Parameters
fast_loop_start_28 = FastLoopStart(Iterations=subtraction_13, Data=scale_173.Geometry)  # -> port, Counter, Data
list_item_31 = ListItem(List=area_49.Centroid, Index=0, Wrap=True)
geometry_135 = Geometry(geometry_134)
fast_loop_end_21 = FastLoopEnd(port=fast_loop_start_21.port, Exit=False, Data=scale_159.Geometry, RecordData=False, TimeOutVal=0)
ggnetworkpolygons_9 = GgNetworkPolygons(Curves=explode_11.Segments, PerimOrVoid=3)  # disabled
fast_loop_end_22 = FastLoopEnd(port=fast_loop_start_20.port, Exit=False, Data=scale_160.Geometry, RecordData=False, TimeOutVal=0)
merge_46 = Merge(Data1=scale_114.Geometry, Data2=fast_loop_end_18)
ggnetworkpolygons_10 = GgNetworkPolygons(Curves=explode_12.Segments, PerimOrVoid=3)  # disabled
ggnetworkpolygons_11 = GgNetworkPolygons(Curves=explode_13.Segments, PerimOrVoid=3)  # disabled
list_item_32 = ListItem(List=area_51.Centroid, Index=0, Wrap=True)
merge_47 = Merge(Data1=scale_118.Geometry, Data2=fast_loop_end_19)
stream_filter_38 = StreamFilter(Gate=number_slider_4, Stream0=fast_loop_end_18, Stream1=merge_46)
stream_filter_39 = StreamFilter(Gate=number_slider_4, Stream0=fast_loop_end_19, Stream1=merge_47)
ggnetworkpolygons_12 = GgNetworkPolygons(Curves=explode_14.Segments, PerimOrVoid=3)  # disabled
fast_loop_end_23 = FastLoopEnd(port=fast_loop_start_23.port, Exit=False, Data=scale_165.Geometry, RecordData=True, TimeOutVal=0)
ggnetworkpolygons_13 = GgNetworkPolygons(Curves=explode_15.Segments, PerimOrVoid=3)  # disabled
ggnetworkpolygons_14 = GgNetworkPolygons(Curves=explode_16.Segments, PerimOrVoid=3)  # disabled
center_25 = Center(Geometry=geometry_135)  # -> Center, Dimension
scale_175 = Scale(Geometry=geometry_135, Center=center_25.Center, Factor=expr("X*3", power))  # -> Geometry, Transform
area_56 = Area(Geometry=scale_175.Geometry)  # -> Area, Centroid
scale_176 = Scale(Geometry=geometry_134, Center=area_56.Centroid, Factor=stream_filter_2)  # -> Geometry, Transform
discontinuity_16 = Discontinuity(Curve=scale_176.Geometry, Level=1)  # -> Points, Parameters
fast_loop_start_29 = FastLoopStart(Iterations=subtraction_14, Data=scale_175.Geometry)  # -> port, Counter, Data
ggnetworkpolygons_15 = GgNetworkPolygons(Curves=explode_17.Segments, PerimOrVoid=3)  # disabled
list_item_33 = ListItem(List=area_52.Centroid, Index=0, Wrap=True)
fast_loop_end_24 = FastLoopEnd(port=fast_loop_start_24.port, Exit=False, Data=scale_166.Geometry, RecordData=False, TimeOutVal=0)
scale_177 = Scale(Geometry=graft(fast_loop_start_27.Data), Center=discontinuity_14.Points, Factor=stream_filter)  # -> Geometry, Transform
fast_loop_end_25 = FastLoopEnd(port=fast_loop_start_25.port, Exit=False, Data=scale_167.Geometry, RecordData=False, TimeOutVal=0)
parameter_pipe_mesh = ParameterPipeMesh(
    Curve=scale_95.Geometry,
    Radius=0.1111111111,
    ParametersU=[0, 0.1666666667, 0.3333333333, 0.5, 0.6666666667, 0.8333333333, 1],
    ParametersV=[0, 0.1666666667, 0.3333333333, 0.5, 0.6666666667, 0.8333333333, 1],
    Weighted=False,
    Lengths=True,
    Angle=0,
    Rotation=15,
    EndType=0,
    Triangulate=False)  # disabled
merge_48 = Merge(Data1=scale_146.Geometry, Data2=fast_loop_end_20)
scale_178 = Scale(Geometry=graft(fast_loop_start_28.Data), Center=discontinuity_15.Points, Factor=stream_filter)  # -> Geometry, Transform
merge_49 = Merge(Data1=scale_144.Geometry, Data2=fast_loop_end_21)
stream_filter_40 = StreamFilter(Gate=number_slider_4, Stream0=fast_loop_end_20, Stream1=merge_48)
merge_50 = Merge(Data1=scale_138.Geometry, Data2=fast_loop_end_22)
stream_filter_41 = StreamFilter(Gate=number_slider_4, Stream0=fast_loop_end_21, Stream1=merge_49)
area_57 = Area(Geometry=geometry_89)  # -> Area, Centroid
stream_filter_42 = StreamFilter(Gate=number_slider_4, Stream0=fast_loop_end_22, Stream1=merge_50)
area_58 = Area(Geometry=geometry_122)  # -> Area, Centroid
merge_51 = Merge(Data1=scale_152.Geometry, Data2=fast_loop_end_23)
fast_loop_end_26 = FastLoopEnd(port=fast_loop_start_26.port, Exit=False, Data=scale_170.Geometry, RecordData=False, TimeOutVal=0)
stream_filter_43 = StreamFilter(Gate=number_slider_4, Stream0=fast_loop_end_23, Stream1=merge_51)
merge_52 = Merge(Data1=scale_154.Geometry, Data2=fast_loop_end_24)
face_boundaries_7 = FaceBoundaries(Mesh=parameter_pipe_mesh)
stream_filter_44 = StreamFilter(Gate=number_slider_4, Stream0=fast_loop_end_24, Stream1=merge_52)
merge_53 = Merge(Data1=scale_156.Geometry, Data2=fast_loop_end_25)
scale_179 = Scale(Geometry=graft(fast_loop_start_29.Data), Center=discontinuity_16.Points, Factor=stream_filter)  # -> Geometry, Transform
stream_filter_45 = StreamFilter(Gate=number_slider_4, Stream0=fast_loop_end_25, Stream1=merge_53)
area_59 = Area(Geometry=geometry_130)  # -> Area, Centroid
list_item_34 = ListItem(List=area_57.Centroid, Index=0, Wrap=True)
merge_54 = Merge(Data1=scale_161.Geometry, Data2=fast_loop_end_26)
list_item_35 = ListItem(List=area_58.Centroid, Index=0, Wrap=True)
stream_filter_46 = StreamFilter(Gate=number_slider_4, Stream0=fast_loop_end_26, Stream1=merge_54)
triangle_mapping = TriangleMapping(Geometry=flatten(merge_8), Source=circumscribed_polygon, Target=graft(merge_44))  # -> flatten(Geometry), Transform
fast_loop_end_27 = FastLoopEnd(port=fast_loop_start_27.port, Exit=False, Data=scale_177.Geometry, RecordData=False, TimeOutVal=0)
fast_loop_end_28 = FastLoopEnd(port=fast_loop_start_28.port, Exit=False, Data=scale_178.Geometry, RecordData=False, TimeOutVal=0)
list_item_36 = ListItem(List=area_59.Centroid, Index=0, Wrap=True)
merge_55 = Merge(Data1=scale_168.Geometry, Data2=fast_loop_end_27)
fast_loop_end_29 = FastLoopEnd(port=fast_loop_start_29.port, Exit=False, Data=scale_179.Geometry, RecordData=False, TimeOutVal=0)
stream_filter_47 = StreamFilter(Gate=number_slider_4, Stream0=fast_loop_end_27, Stream1=merge_55)
merge_56 = Merge(Data1=scale_173.Geometry, Data2=fast_loop_end_28)
stream_filter_48 = StreamFilter(Gate=number_slider_4, Stream0=fast_loop_end_28, Stream1=merge_56)
boundary_surfaces_13 = BoundarySurfaces(Edges=triangle_mapping.Geometry)  # disabled
deconstruct_arc_9 = DeconstructArc(Arc=triangle_mapping.Geometry)  # -> BasePlane, Radius, Angle
merge_57 = Merge(Data1=scale_175.Geometry, Data2=fast_loop_end_29)
stream_filter_49 = StreamFilter(Gate=number_slider_4, Stream0=fast_loop_end_29, Stream1=merge_57)
area_60 = Area(Geometry=ggnetworkpolygons_5)  # -> Area, Centroid; disabled
to_polar = ToPolar(Point=area_60.Centroid, System=PlaneXY(0, 0, 0))  # -> Phi, Theta, Radius; disabled
degrees = Degrees(Radians=to_polar.Phi)  # disabled
includes = Includes(Value=degrees, Domain=construct_domain)  # -> Includes, Deviation; disabled
cull_pattern_9 = CullPattern(List=ggnetworkpolygons_5, CullPattern=includes.Includes)  # disabled
sort_list = SortList(Keys=deconstruct_arc_9.Radius)  # -> reverse(Keys), ValuesValuesA
panel_19 = Panel(degrees)  # disabled
curve_display_3 = CurveDisplay(Curves=cull_pattern_9, Thickness=2, Color=RGB(255, 0, 0))  # disabled
panel_20 = Panel(sort_list.Keys)
boundary_surfaces_14 = BoundarySurfaces(Edges=triangle_mapping.Geometry)  # disabled

explode_19 = Explode(Curve=scale_95.Geometry, Recursive=True)  # -> Segments, Vertices; disabled
list_item_37 = ListItem(List=explode_19.Segments, Index=0, Wrap=True)  # disabled
geometry_136 = Geometry(orient_19.Geometry)
end_points_2 = EndPoints(Curve=list_item_37)  # -> flatten(Start), End; disabled
list_item_38 = ListItem(List=geometry_136, Index=0, Wrap=True)
merge_58 = Merge(Data1=end_points_2.Start)  # disabled
geometry_137 = Geometry(shift_list)
area_61 = Area(Geometry=geometry_137)  # -> Area, Centroid
list_item_39 = ListItem(List=area_61.Centroid, Index=1, Wrap=True)

area_62 = Area(Geometry=list_item_38)  # -> Area, Centroid
list_item_40 = ListItem(List=geometry_136, Index=0, Wrap=True)  # disabled

scale_180 = Scale(Geometry=list_item_38, Center=area_62.Centroid, Factor=power)  # -> Geometry, Transform

geometry_138 = Geometry(scale_180.Geometry)

area_63 = Area(Geometry=geometry_138)  # -> Area, Centroid

rotate_27 = Rotate(Geometry=geometry_138, Angle=degrees(30), Plane=area_63.Centroid)  # -> Geometry, Transform
scale_181 = Scale(Geometry=rotate_27.Geometry, Center=area_63.Centroid, Factor="SQRT(3)/2")  # -> Geometry, Transform
geometry_139 = Geometry(scale_181.Geometry)

stream_filter_50 = StreamFilter(Gate=number_slider_5, Stream0=geometry_138, Stream1=geometry_139)
geometry_140 = Geometry(stream_filter_50)

geometry_141 = Geometry(geometry_140)
center_26 = Center(Geometry=geometry_141)  # -> Center, Dimension
scale_182 = Scale(Geometry=geometry_141, Center=center_26.Center, Factor=expr("X*3", power))  # -> Geometry, Transform
scale_183 = Scale(Geometry=geometry_140, Center=area_63.Centroid, Factor=stream_filter_2)  # -> Geometry, Transform
discontinuity_17 = Discontinuity(Curve=scale_183.Geometry, Level=1)  # -> Points, Parameters
fast_loop_start_30 = FastLoopStart(Iterations=addition, Data=scale_182.Geometry)  # -> port, Counter, Data
scale_184 = Scale(Geometry=graft(fast_loop_start_30.Data), Center=discontinuity_17.Points, Factor=stream_filter)  # -> Geometry, Transform
fast_loop_end_30 = FastLoopEnd(port=fast_loop_start_30.port, Exit=False, Data=scale_184.Geometry, RecordData=False, TimeOutVal=0)
merge_59 = Merge(Data1=scale_182.Geometry, Data2=fast_loop_end_30)

stream_filter_51 = StreamFilter(Gate=number_slider_4, Stream0=fast_loop_end_30, Stream1=merge_59)
rotate_28 = Rotate(Geometry=stream_filter_51, Angle=degrees(60), Plane=PlaneXY(0, 0, 0))  # -> Geometry, Transform
move_4 = Move(Geometry=rotate_28.Geometry, Motion=Vector(0, -0.3849001795, 0))  # -> Geometry, Transform

orient_20 = Orient(Geometry=graft(stream_filter_51), Source=list_item_39, Target=flatten(point))  # -> Geometry, Transform

scale_185 = Scale(Geometry=orient_20.Geometry, Center=Point(0, 0, 0), Factor=3)  # -> Geometry, Transform
geometry_142 = Geometry(scale_185.Geometry)
scale_186 = Scale(Geometry=move_4.Geometry, Center=Point(0, 0, 0), Factor=3)  # -> Geometry, Transform
ᴎɴ_8_ᴎɴᴥᑐᑕᔓᔕᴎɴ_ᴎɴᔓᔕᑐᑕᴥ_8_ᴎɴ_ᗱᗴ_ᑐᑕᴥ_ᑐᑕ_ᴥᑐ = ᴎɴ8ᴎɴᴥᑐᑕᔓᔕᴎɴᴎɴᔓᔕᑐᑕᴥ8ᴎɴᗱᗴᑐᑕᴥᑐᑕᴥᑐᑕᗱᗴᴎɴ8ᴎɴᴥᑐᑕᔓᔕᴎɴᴎɴᔓᔕᑐᑕᴥ8ᴎɴ(x=1, x_2=orient_20.Geometry, x_3=9)  # "◙ ᴎɴⓄ⊙✣8⊙ᴎɴᴥᑐᑕᔓᔕᴎɴ⊙ᴎɴᔓᔕᑐᑕᴥ⊙8✣⊙Ⓞᴎɴ◯ᗱᗴ◇ᑐᑕᴥ⊙ᑐᑕ⊙ᴥᑐᑕ◇ᗱᗴ◯ᴎɴⓄ⊙✣8⊙ᴎɴᴥᑐᑕᔓᔕᴎɴ⊙ᴎɴᔓᔕᑐᑕᴥ⊙8✣⊙Ⓞᴎɴ ◙"; disabled
geometry_143 = Geometry(scale_186.Geometry)

rotate_29 = Rotate(Geometry=orient_20.Geometry, Angle=degrees(30), Plane=area_61.Centroid)  # -> Geometry, Transform; disabled
scale_187 = Scale(Geometry=rotate_29.Geometry, Center=area_61.Centroid, Factor=panel_18)  # -> Geometry, Transform; disabled

geometry_144 = Geometry(ᴎɴ_8_ᴎɴᴥᑐᑕᔓᔕᴎɴ_ᴎɴᔓᔕᑐᑕᴥ_8_ᴎɴ_ᗱᗴ_ᑐᑕᴥ_ᑐᑕ_ᴥᑐ)  # disabled
deconstruct_arc_10 = DeconstructArc(Arc=ᴎɴ_8_ᴎɴᴥᑐᑕᔓᔕᴎɴ_ᴎɴᔓᔕᑐᑕᴥ_8_ᴎɴ_ᗱᗴ_ᑐᑕᴥ_ᑐᑕ_ᴥᑐ)  # -> BasePlane, Radius, Angle; disabled
stream_filter_52 = StreamFilter(Gate=0, Stream0=scale_39.Geometry, Stream1=geometry_143)

explode_20 = Explode(Curve=scale_95.Geometry, Recursive=True)  # -> Segments, Vertices
list_item_41 = ListItem(List=explode_20.Segments, Index=0, Wrap=True)
geometry_145 = Geometry(orient_19.Geometry)
end_points_3 = EndPoints(Curve=list_item_41)  # -> flatten(Start), End
list_item_42 = ListItem(List=geometry_145, Index=0, Wrap=True)
merge_60 = Merge(Data1=end_points_3.Start)
geometry_146 = Geometry(shift_list)
area_64 = Area(Geometry=geometry_146)  # -> Area, Centroid
list_item_43 = ListItem(List=area_64.Centroid, Index=1, Wrap=True)

area_65 = Area(Geometry=list_item_42)  # -> Area, Centroid
list_item_44 = ListItem(List=geometry_145, Index=0, Wrap=True)

scale_188 = Scale(Geometry=list_item_42, Center=area_65.Centroid, Factor=power)  # -> Geometry, Transform

geometry_147 = Geometry(scale_188.Geometry)

area_66 = Area(Geometry=geometry_147)  # -> Area, Centroid
scale_189 = Scale(Geometry=geometry_147, Center=area_66.Centroid, Factor=stream_filter_2)  # -> Geometry, Transform
discontinuity_18 = Discontinuity(Curve=scale_189.Geometry, Level=1)  # -> Points, Parameters

rotate_30 = Rotate(Geometry=geometry_147, Angle=degrees(30), Plane=area_66.Centroid)  # -> Geometry, Transform
scale_190 = Scale(Geometry=rotate_30.Geometry, Center=area_66.Centroid, Factor="SQRT(3)/2")  # -> Geometry, Transform
geometry_148 = Geometry(scale_190.Geometry)

stream_filter_53 = StreamFilter(Gate=number_slider_5, Stream0=geometry_147, Stream1=geometry_148)
geometry_149 = Geometry(stream_filter_53)
geometry_150 = Geometry(geometry_149)
center_27 = Center(Geometry=geometry_150)  # -> Center, Dimension
scale_191 = Scale(Geometry=geometry_150, Center=center_27.Center, Factor=expr("X*3", power))  # -> Geometry, Transform
stream_filter_54 = StreamFilter(Gate=number_slider_2, Stream0=scale_191.Geometry, Stream1=stream_filter_35)
area_67 = Area(Geometry=stream_filter_54)  # -> Area, Centroid
stream_filter_55 = StreamFilter(Gate=number_slider_2, Stream0=scale_191.Geometry, Stream1=stream_filter_37)
area_68 = Area(Geometry=stream_filter_55)  # -> Area, Centroid
stream_filter_56 = StreamFilter(Gate=number_slider_2, Stream0=scale_191.Geometry, Stream1=stream_filter_39)
area_69 = Area(Geometry=stream_filter_56)  # -> Area, Centroid
stream_filter_57 = StreamFilter(Gate=number_slider_2, Stream0=scale_191.Geometry, Stream1=stream_filter_38)
area_70 = Area(Geometry=stream_filter_57)  # -> Area, Centroid
loop_start_3 = LoopStart(Repeat=number_slider, Trigger=true_only_button, Data=scale_191.Geometry)  # -> port, Counter, Data
stream_filter_58 = StreamFilter(Gate=number_slider_2, Stream0=scale_191.Geometry, Stream1=stream_filter_40)
area_71 = Area(Geometry=stream_filter_58)  # -> Area, Centroid
stream_filter_59 = StreamFilter(Gate=number_slider_2, Stream0=scale_191.Geometry, Stream1=stream_filter_41)
area_72 = Area(Geometry=stream_filter_59)  # -> Area, Centroid
stream_filter_60 = StreamFilter(Gate=number_slider_2, Stream0=scale_191.Geometry, Stream1=stream_filter_42)
area_73 = Area(Geometry=stream_filter_60)  # -> Area, Centroid
stream_filter_61 = StreamFilter(Gate=number_slider_2, Stream0=scale_191.Geometry, Stream1=stream_filter_43)
area_74 = Area(Geometry=stream_filter_61)  # -> Area, Centroid
stream_filter_62 = StreamFilter(Gate=number_slider_2, Stream0=scale_191.Geometry, Stream1=stream_filter_44)
area_75 = Area(Geometry=stream_filter_62)  # -> Area, Centroid
stream_filter_63 = StreamFilter(Gate=number_slider_2, Stream0=scale_191.Geometry, Stream1=stream_filter_45)
area_76 = Area(Geometry=stream_filter_63)  # -> Area, Centroid
stream_filter_64 = StreamFilter(Gate=number_slider_2, Stream0=scale_191.Geometry, Stream1=stream_filter_46)
area_77 = Area(Geometry=stream_filter_64)  # -> Area, Centroid
stream_filter_65 = StreamFilter(Gate=number_slider_2, Stream0=scale_191.Geometry, Stream1=stream_filter_47)
area_78 = Area(Geometry=stream_filter_65)  # -> Area, Centroid
stream_filter_66 = StreamFilter(Gate=number_slider_2, Stream0=scale_191.Geometry, Stream1=stream_filter_48)
area_79 = Area(Geometry=stream_filter_66)  # -> Area, Centroid
stream_filter_67 = StreamFilter(Gate=number_slider_2, Stream0=scale_191.Geometry, Stream1=stream_filter_49)
area_80 = Area(Geometry=stream_filter_67)  # -> Area, Centroid

fast_loop_start_31 = FastLoopStart(Iterations=number_slider, Data=scale_191.Geometry)  # -> port, Counter, Data; disabled
scale_192 = Scale(Geometry=graft(loop_start_3.Data), Center=discontinuity_18.Points, Factor=stream_filter)  # -> Geometry, Transform
fast_loop_end_31 = FastLoopEnd(port=fast_loop_start_31.port, Exit=False, RecordData=True, TimeOutVal=0)  # disabled

loop_end_3 = LoopEnd(port=loop_start_3.port, Exit=False, Data=scale_192.Geometry, TimeOutVal=0, pausedState=False, state="Constant & Record")

merge_61 = Merge(Data1=scale_191.Geometry, Data2=loop_end_3)

stream_filter_68 = StreamFilter(Gate=number_slider_4, Stream0=loop_end_3, Stream1=merge_61)
rotate_31 = Rotate(Geometry=stream_filter_68, Angle=degrees(60), Plane=PlaneXY(0, 0, 0))  # -> Geometry, Transform
move_5 = Move(Geometry=rotate_31.Geometry, Motion=Vector(0, -0.2566001196, 0))  # -> Geometry, Transform; disabled
polar_array_10 = PolarArray(Geometry=move_5.Geometry, Plane=PlaneXY(0, 0, 0), Count=6, Angle=6.283185307)  # -> Geometry, Transform; disabled
move_6 = Move(Geometry=rotate_31.Geometry, Motion=vector_xyz.Vector)  # -> Geometry, Transform
merge_62 = Merge(Data2=move_6.Geometry)
fast_loop_start_32 = FastLoopStart(Iterations=2, Data=flatten(merge_62))  # -> port, Counter, Data
scale_193 = Scale(Geometry=fast_loop_start_32.Data, Center=construct_point, Factor=0.3333333333)  # -> Geometry, Transform
fast_loop_end_32 = FastLoopEnd(port=fast_loop_start_32.port, Exit=False, Data=scale_193.Geometry, RecordData=True, TimeOutVal=0)  # disabled
merge_63 = Merge(Data1=merge_62, Data2=fast_loop_end_32)
scale_194 = Scale(Geometry=stream_filter_68, Center=area_67.Centroid, Factor=division_2)  # -> Geometry, Transform
scale_195 = Scale(Geometry=stream_filter_68, Center=area_68.Centroid, Factor=division_3)  # -> Geometry, Transform
scale_196 = Scale(Geometry=stream_filter_68, Center=area_70.Centroid, Factor=division_5)  # -> Geometry, Transform
scale_197 = Scale(Geometry=stream_filter_68, Center=area_69.Centroid, Factor=division_6)  # -> Geometry, Transform
scale_198 = Scale(Geometry=stream_filter_68, Center=area_71.Centroid, Factor=division_7)  # -> Geometry, Transform
scale_199 = Scale(Geometry=stream_filter_68, Center=area_72.Centroid, Factor=division_8)  # -> Geometry, Transform
scale_200 = Scale(Geometry=stream_filter_68, Center=area_73.Centroid, Factor=division_9)  # -> Geometry, Transform
rotate_32 = Rotate(Geometry=stream_filter_68, Angle=degrees(60), Plane=PlaneXY(0, 0, 0))  # -> Geometry, Transform; disabled
scale_201 = Scale(Geometry=stream_filter_68, Center=area_74.Centroid, Factor=division_11)  # -> Geometry, Transform
orient_21 = Orient(Geometry=scale_194.Geometry, Source=area_67.Centroid, Target=list_item_21)  # -> Geometry, Transform
orient_22 = Orient(Geometry=scale_195.Geometry, Source=area_68.Centroid, Target=list_item_22)  # -> Geometry, Transform
scale_202 = Scale(Geometry=stream_filter_68, Center=area_75.Centroid, Factor=division_12)  # -> Geometry, Transform
scale_203 = Scale(Geometry=stream_filter_68, Center=area_76.Centroid, Factor=division_13)  # -> Geometry, Transform
orient_23 = Orient(Geometry=scale_196.Geometry, Source=area_70.Centroid, Target=list_item_24)  # -> Geometry, Transform
orient_24 = Orient(Geometry=scale_197.Geometry, Source=area_69.Centroid, Target=list_item_25)  # -> Geometry, Transform
scale_204 = Scale(Geometry=stream_filter_68, Center=area_77.Centroid, Factor=division_15)  # -> Geometry, Transform
stream_filter_69 = StreamFilter(Gate=number_slider_2, Stream0=orient_21.Geometry, Stream1=stream_filter_35)
stream_filter_70 = StreamFilter(Gate=number_slider_2, Stream0=orient_22.Geometry, Stream1=stream_filter_37)
orient_25 = Orient(Geometry=scale_198.Geometry, Source=area_71.Centroid, Target=list_item_26)  # -> Geometry, Transform
orient_26 = Orient(Geometry=scale_199.Geometry, Source=area_72.Centroid, Target=list_item_27)  # -> Geometry, Transform
stream_filter_71 = StreamFilter(Gate=number_slider_2, Stream0=orient_23.Geometry, Stream1=stream_filter_38)
orient_27 = Orient(Geometry=scale_200.Geometry, Source=area_73.Centroid, Target=list_item_28)  # -> Geometry, Transform
stream_filter_72 = StreamFilter(Gate=number_slider_2, Stream0=orient_24.Geometry, Stream1=stream_filter_39)
orient_28 = Orient(Geometry=scale_201.Geometry, Source=area_74.Centroid, Target=list_item_29)  # -> Geometry, Transform
orient_29 = Orient(Geometry=graft(stream_filter_69), Source=list_item_21, Target=flatten(area_31.Centroid))  # -> Geometry, Transform
merge_64 = Merge(Data1=geometry_68, Data2=orient_29.Geometry)  # disabled
move_7 = Move(Geometry=rotate_32.Geometry, Motion=Vector(0, -0.3849001795, 0))  # -> Geometry, Transform; disabled
orient_30 = Orient(Geometry=graft(stream_filter_70), Source=list_item_22, Target=flatten(center_17.Center))  # -> Geometry, Transform
merge_65 = Merge(Data1=geometry_80, Data2=orient_30.Geometry)  # disabled
orient_31 = Orient(Geometry=scale_202.Geometry, Source=area_75.Centroid, Target=list_item_31)  # -> Geometry, Transform
area_81 = Area(Geometry=orient_30.Geometry)  # -> Area, Centroid; disabled
stream_filter_73 = StreamFilter(Gate=number_slider_2, Stream0=orient_25.Geometry, Stream1=stream_filter_40)
orient_32 = Orient(Geometry=scale_203.Geometry, Source=area_76.Centroid, Target=list_item_32)  # -> Geometry, Transform
stream_filter_74 = StreamFilter(Gate=number_slider_2, Stream0=orient_26.Geometry, Stream1=stream_filter_41)
scale_205 = Scale(Geometry=stream_filter_68, Center=area_78.Centroid, Factor=division_18)  # -> Geometry, Transform
stream_filter_75 = StreamFilter(Gate=number_slider_2, Stream0=orient_27.Geometry, Stream1=stream_filter_42)
orient_33 = Orient(Geometry=graft(stream_filter_71), Source=list_item_24, Target=flatten(area_38.Centroid))  # -> Geometry, Transform
merge_66 = Merge(Data1=geometry_55, Data2=orient_33.Geometry)  # disabled
orient_34 = Orient(Geometry=graft(stream_filter_72), Source=list_item_25, Target=flatten(area_39.Centroid))  # -> Geometry, Transform
merge_67 = Merge(Data1=geometry_62, Data2=orient_34.Geometry)  # disabled
scale_206 = Scale(Geometry=stream_filter_68, Center=area_79.Centroid, Factor=division_19)  # -> Geometry, Transform
stream_filter_76 = StreamFilter(Gate=number_slider_2, Stream0=orient_28.Geometry, Stream1=stream_filter_43)

orient_35 = Orient(Geometry=graft(stream_filter_68), Source=list_item_43, Target=flatten(area_64.Centroid))  # -> Geometry, Transform
merge_68 = Merge(Data1=geometry_145, Data2=orient_35.Geometry)  # disabled

orient_36 = Orient(Geometry=scale_204.Geometry, Source=area_77.Centroid, Target=list_item_33)  # -> Geometry, Transform
stream_filter_77 = StreamFilter(Gate=number_slider_2, Stream0=orient_31.Geometry, Stream1=stream_filter_44)
stream_filter_78 = StreamFilter(Gate=number_slider_2, Stream0=orient_32.Geometry, Stream1=stream_filter_45)
orient_37 = Orient(Geometry=graft(stream_filter_73), Source=list_item_26, Target=flatten(area_45.Centroid))  # -> Geometry, Transform
merge_69 = Merge(Data1=geometry_52, Data2=orient_37.Geometry)  # disabled
orient_38 = Orient(Geometry=graft(stream_filter_74), Source=list_item_27, Target=flatten(area_46.Centroid))  # -> Geometry, Transform
merge_70 = Merge(Data1=geometry_74, Data2=orient_38.Geometry)  # disabled
orient_39 = Orient(Geometry=graft(stream_filter_75), Source=list_item_28, Target=flatten(area_47.Centroid))  # -> Geometry, Transform
merge_71 = Merge(Data1=geometry_100, Data2=orient_39.Geometry)  # disabled
scale_207 = Scale(Geometry=stream_filter_68, Center=area_80.Centroid, Factor=division_20)  # -> Geometry, Transform
orient_40 = Orient(Geometry=graft(stream_filter_76), Source=list_item_29, Target=flatten(area_48.Centroid))  # -> Geometry, Transform
merge_72 = Merge(Data1=geometry_92, Data2=orient_40.Geometry)  # disabled
rotate_33 = Rotate(Geometry=stream_filter_76, Angle=degrees(60), Plane=PlaneXY(0, 0, 0))  # -> Geometry, Transform
geometry_151 = Geometry(area_81.Centroid)  # disabled
stream_filter_79 = StreamFilter(Gate=number_slider_2, Stream0=orient_36.Geometry, Stream1=stream_filter_46)
orient_41 = Orient(Geometry=graft(stream_filter_77), Source=list_item_31, Target=flatten(area_49.Centroid))  # -> Geometry, Transform
merge_73 = Merge(Data1=geometry_86, Data2=orient_41.Geometry)  # disabled
move_8 = Move(Geometry=rotate_32.Geometry, Motion=Vector(0, -0.2566001196, 0))  # -> Geometry, Transform; disabled
orient_42 = Orient(Geometry=graft(stream_filter_78), Source=list_item_32, Target=flatten(area_51.Centroid))  # -> Geometry, Transform
merge_74 = Merge(Data1=geometry_109, Data2=orient_42.Geometry)  # disabled
polar_array_11 = PolarArray(Geometry=move_8.Geometry, Plane=PlaneXY(0, 0, 0), Count=6, Angle=6.283185307)  # -> Geometry, Transform; disabled
scale_208 = Scale(Geometry=move_7.Geometry, Center=Point(0, 0, 0), Factor=3)  # -> Geometry, Transform; disabled
orient_43 = Orient(Geometry=scale_205.Geometry, Source=area_78.Centroid, Target=list_item_34)  # -> Geometry, Transform
orient_44 = Orient(Geometry=scale_206.Geometry, Source=area_79.Centroid, Target=list_item_35)  # -> Geometry, Transform
orient_45 = Orient(Geometry=graft(stream_filter_79), Source=list_item_33, Target=flatten(area_52.Centroid))  # -> Geometry, Transform
merge_75 = Merge(Data1=geometry_115, Data2=orient_45.Geometry)  # disabled
ᴎɴ_8_ᴎɴᴥᑐᑕᔓᔕᴎɴ_ᴎɴᔓᔕᑐᑕᴥ_8_ᴎɴ_ᗱᗴ_ᑐᑕᴥ_ᑐᑕ_ᴥᑐ_2 = ᴎɴ8ᴎɴᴥᑐᑕᔓᔕᴎɴᴎɴᔓᔕᑐᑕᴥ8ᴎɴᗱᗴᑐᑕᴥᑐᑕᴥᑐᑕᗱᗴᴎɴ8ᴎɴᴥᑐᑕᔓᔕᴎɴᴎɴᔓᔕᑐᑕᴥ8ᴎɴ(x=1, x_2=orient_35.Geometry, x_3=9)  # "◙ ᴎɴⓄ⊙✣8⊙ᴎɴᴥᑐᑕᔓᔕᴎɴ⊙ᴎɴᔓᔕᑐᑕᴥ⊙8✣⊙Ⓞᴎɴ◯ᗱᗴ◇ᑐᑕᴥ⊙ᑐᑕ⊙ᴥᑐᑕ◇ᗱᗴ◯ᴎɴⓄ⊙✣8⊙ᴎɴᴥᑐᑕᔓᔕᴎɴ⊙ᴎɴᔓᔕᑐᑕᴥ⊙8✣⊙Ⓞᴎɴ ◙"; disabled
ᴎɴ_8_ᴎɴᴥᑐᑕᔓᔕᴎɴ_ᴎɴᔓᔕᑐᑕᴥ_8_ᴎɴ_ᗱᗴ_ᑐᑕᴥ_ᑐᑕ_ᴥᑐ_3 = ᴎɴ8ᴎɴᴥᑐᑕᔓᔕᴎɴᴎɴᔓᔕᑐᑕᴥ8ᴎɴᗱᗴᑐᑕᴥᑐᑕᴥᑐᑕᗱᗴᴎɴ8ᴎɴᴥᑐᑕᔓᔕᴎɴᴎɴᔓᔕᑐᑕᴥ8ᴎɴ(x=1, x_2=orient_29.Geometry, x_3=9)  # "◙ ᴎɴⓄ⊙✣8⊙ᴎɴᴥᑐᑕᔓᔕᴎɴ⊙ᴎɴᔓᔕᑐᑕᴥ⊙8✣⊙Ⓞᴎɴ◯ᗱᗴ◇ᑐᑕᴥ⊙ᑐᑕ⊙ᴥᑐᑕ◇ᗱᗴ◯ᴎɴⓄ⊙✣8⊙ᴎɴᴥᑐᑕᔓᔕᴎɴ⊙ᴎɴᔓᔕᑐᑕᴥ⊙8✣⊙Ⓞᴎɴ ◙"; disabled
geometry_152 = Geometry(scale_208.Geometry)  # disabled
ᴎɴ_8_ᴎɴᴥᑐᑕᔓᔕᴎɴ_ᴎɴᔓᔕᑐᑕᴥ_8_ᴎɴ_ᗱᗴ_ᑐᑕᴥ_ᑐᑕ_ᴥᑐ_4 = ᴎɴ8ᴎɴᴥᑐᑕᔓᔕᴎɴᴎɴᔓᔕᑐᑕᴥ8ᴎɴᗱᗴᑐᑕᴥᑐᑕᴥᑐᑕᗱᗴᴎɴ8ᴎɴᴥᑐᑕᔓᔕᴎɴᴎɴᔓᔕᑐᑕᴥ8ᴎɴ(x=1, x_2=orient_30.Geometry, x_3=9)  # "◙ ᴎɴⓄ⊙✣8⊙ᴎɴᴥᑐᑕᔓᔕᴎɴ⊙ᴎɴᔓᔕᑐᑕᴥ⊙8✣⊙Ⓞᴎɴ◯ᗱᗴ◇ᑐᑕᴥ⊙ᑐᑕ⊙ᴥᑐᑕ◇ᗱᗴ◯ᴎɴⓄ⊙✣8⊙ᴎɴᴥᑐᑕᔓᔕᴎɴ⊙ᴎɴᔓᔕᑐᑕᴥ⊙8✣⊙Ⓞᴎɴ ◙"; disabled
stream_filter_80 = StreamFilter(Gate=number_slider_2, Stream0=orient_43.Geometry, Stream1=stream_filter_47)
geometry_153 = Geometry(ᴎɴ_8_ᴎɴᴥᑐᑕᔓᔕᴎɴ_ᴎɴᔓᔕᑐᑕᴥ_8_ᴎɴ_ᗱᗴ_ᑐᑕᴥ_ᑐᑕ_ᴥᑐ_2)  # disabled

rotate_34 = Rotate(Geometry=orient_35.Geometry, Angle=degrees(30), Plane=area_64.Centroid)  # -> Geometry, Transform; disabled
panel_21 = Panel("SQRT(3)/2")  # disabled
scale_209 = Scale(Geometry=rotate_34.Geometry, Center=area_64.Centroid, Factor=panel_21)  # -> Geometry, Transform; disabled

stream_filter_81 = StreamFilter(Gate=number_slider_2, Stream0=orient_44.Geometry, Stream1=stream_filter_48)
orient_46 = Orient(Geometry=scale_207.Geometry, Source=area_80.Centroid, Target=list_item_36)  # -> Geometry, Transform
geometry_154 = Geometry(ᴎɴ_8_ᴎɴᴥᑐᑕᔓᔕᴎɴ_ᴎɴᔓᔕᑐᑕᴥ_8_ᴎɴ_ᗱᗴ_ᑐᑕᴥ_ᑐᑕ_ᴥᑐ_3)
ᴎɴ_8_ᴎɴᴥᑐᑕᔓᔕᴎɴ_ᴎɴᔓᔕᑐᑕᴥ_8_ᴎɴ_ᗱᗴ_ᑐᑕᴥ_ᑐᑕ_ᴥᑐ_5 = ᴎɴ8ᴎɴᴥᑐᑕᔓᔕᴎɴᴎɴᔓᔕᑐᑕᴥ8ᴎɴᗱᗴᑐᑕᴥᑐᑕᴥᑐᑕᗱᗴᴎɴ8ᴎɴᴥᑐᑕᔓᔕᴎɴᴎɴᔓᔕᑐᑕᴥ8ᴎɴ(x=1, x_2=orient_33.Geometry, x_3=9)  # "◙ ᴎɴⓄ⊙✣8⊙ᴎɴᴥᑐᑕᔓᔕᴎɴ⊙ᴎɴᔓᔕᑐᑕᴥ⊙8✣⊙Ⓞᴎɴ◯ᗱᗴ◇ᑐᑕᴥ⊙ᑐᑕ⊙ᴥᑐᑕ◇ᗱᗴ◯ᴎɴⓄ⊙✣8⊙ᴎɴᴥᑐᑕᔓᔕᴎɴ⊙ᴎɴᔓᔕᑐᑕᴥ⊙8✣⊙Ⓞᴎɴ ◙"; disabled
ᴎɴ_8_ᴎɴᴥᑐᑕᔓᔕᴎɴ_ᴎɴᔓᔕᑐᑕᴥ_8_ᴎɴ_ᗱᗴ_ᑐᑕᴥ_ᑐᑕ_ᴥᑐ_6 = ᴎɴ8ᴎɴᴥᑐᑕᔓᔕᴎɴᴎɴᔓᔕᑐᑕᴥ8ᴎɴᗱᗴᑐᑕᴥᑐᑕᴥᑐᑕᗱᗴᴎɴ8ᴎɴᴥᑐᑕᔓᔕᴎɴᴎɴᔓᔕᑐᑕᴥ8ᴎɴ(x=1, x_2=orient_34.Geometry, x_3=9)  # "◙ ᴎɴⓄ⊙✣8⊙ᴎɴᴥᑐᑕᔓᔕᴎɴ⊙ᴎɴᔓᔕᑐᑕᴥ⊙8✣⊙Ⓞᴎɴ◯ᗱᗴ◇ᑐᑕᴥ⊙ᑐᑕ⊙ᴥᑐᑕ◇ᗱᗴ◯ᴎɴⓄ⊙✣8⊙ᴎɴᴥᑐᑕᔓᔕᴎɴ⊙ᴎɴᔓᔕᑐᑕᴥ⊙8✣⊙Ⓞᴎɴ ◙"; disabled
geometry_155 = Geometry(ᴎɴ_8_ᴎɴᴥᑐᑕᔓᔕᴎɴ_ᴎɴᔓᔕᑐᑕᴥ_8_ᴎɴ_ᗱᗴ_ᑐᑕᴥ_ᑐᑕ_ᴥᑐ_4)
rotate_35 = Rotate(Geometry=orient_29.Geometry, Angle=degrees(30), Plane=area_31.Centroid)  # -> Geometry, Transform; disabled
move_9 = Move(Geometry=rotate_33.Geometry, Motion=vector_xyz_3.Vector)  # -> Geometry, Transform
rotate_36 = Rotate(Geometry=orient_30.Geometry, Angle=degrees(30), Plane=center_17.Center)  # -> Geometry, Transform; disabled
orient_47 = Orient(Geometry=graft(stream_filter_80), Source=list_item_34, Target=flatten(area_57.Centroid))  # -> Geometry, Transform
merge_76 = Merge(Data1=geometry_90, Data2=orient_47.Geometry)  # disabled
geometry_156 = Geometry(ᴎɴ_8_ᴎɴᴥᑐᑕᔓᔕᴎɴ_ᴎɴᔓᔕᑐᑕᴥ_8_ᴎɴ_ᗱᗴ_ᑐᑕᴥ_ᑐᑕ_ᴥᑐ_5)
geometry_157 = Geometry(ᴎɴ_8_ᴎɴᴥᑐᑕᔓᔕᴎɴ_ᴎɴᔓᔕᑐᑕᴥ_8_ᴎɴ_ᗱᗴ_ᑐᑕᴥ_ᑐᑕ_ᴥᑐ_6)
stream_filter_82 = StreamFilter(Gate=number_slider_2, Stream0=orient_46.Geometry, Stream1=stream_filter_49)
orient_48 = Orient(Geometry=graft(stream_filter_81), Source=list_item_35, Target=flatten(area_58.Centroid))  # -> Geometry, Transform
merge_77 = Merge(Data1=geometry_123, Data2=orient_48.Geometry)  # disabled
deconstruct_arc_11 = DeconstructArc(Arc=ᴎɴ_8_ᴎɴᴥᑐᑕᔓᔕᴎɴ_ᴎɴᔓᔕᑐᑕᴥ_8_ᴎɴ_ᗱᗴ_ᑐᑕᴥ_ᑐᑕ_ᴥᑐ_2)  # -> BasePlane, Radius, Angle; disabled
rotate_37 = Rotate(Geometry=orient_33.Geometry, Angle=degrees(30), Plane=area_38.Centroid)  # -> Geometry, Transform; disabled
rotate_38 = Rotate(Geometry=orient_34.Geometry, Angle=degrees(30), Plane=area_39.Centroid)  # -> Geometry, Transform; disabled
ᴎɴ_8_ᴎɴᴥᑐᑕᔓᔕᴎɴ_ᴎɴᔓᔕᑐᑕᴥ_8_ᴎɴ_ᗱᗴ_ᑐᑕᴥ_ᑐᑕ_ᴥᑐ_7 = ᴎɴ8ᴎɴᴥᑐᑕᔓᔕᴎɴᴎɴᔓᔕᑐᑕᴥ8ᴎɴᗱᗴᑐᑕᴥᑐᑕᴥᑐᑕᗱᗴᴎɴ8ᴎɴᴥᑐᑕᔓᔕᴎɴᴎɴᔓᔕᑐᑕᴥ8ᴎɴ(x=1, x_2=orient_37.Geometry, x_3=9)  # "◙ ᴎɴⓄ⊙✣8⊙ᴎɴᴥᑐᑕᔓᔕᴎɴ⊙ᴎɴᔓᔕᑐᑕᴥ⊙8✣⊙Ⓞᴎɴ◯ᗱᗴ◇ᑐᑕᴥ⊙ᑐᑕ⊙ᴥᑐᑕ◇ᗱᗴ◯ᴎɴⓄ⊙✣8⊙ᴎɴᴥᑐᑕᔓᔕᴎɴ⊙ᴎɴᔓᔕᑐᑕᴥ⊙8✣⊙Ⓞᴎɴ ◙"; disabled
ᴎɴ_8_ᴎɴᴥᑐᑕᔓᔕᴎɴ_ᴎɴᔓᔕᑐᑕᴥ_8_ᴎɴ_ᗱᗴ_ᑐᑕᴥ_ᑐᑕ_ᴥᑐ_8 = ᴎɴ8ᴎɴᴥᑐᑕᔓᔕᴎɴᴎɴᔓᔕᑐᑕᴥ8ᴎɴᗱᗴᑐᑕᴥᑐᑕᴥᑐᑕᗱᗴᴎɴ8ᴎɴᴥᑐᑕᔓᔕᴎɴᴎɴᔓᔕᑐᑕᴥ8ᴎɴ(x=1, x_2=orient_38.Geometry, x_3=9)  # "◙ ᴎɴⓄ⊙✣8⊙ᴎɴᴥᑐᑕᔓᔕᴎɴ⊙ᴎɴᔓᔕᑐᑕᴥ⊙8✣⊙Ⓞᴎɴ◯ᗱᗴ◇ᑐᑕᴥ⊙ᑐᑕ⊙ᴥᑐᑕ◇ᗱᗴ◯ᴎɴⓄ⊙✣8⊙ᴎɴᴥᑐᑕᔓᔕᴎɴ⊙ᴎɴᔓᔕᑐᑕᴥ⊙8✣⊙Ⓞᴎɴ ◙"; disabled
deconstruct_arc_12 = DeconstructArc(Arc=ᴎɴ_8_ᴎɴᴥᑐᑕᔓᔕᴎɴ_ᴎɴᔓᔕᑐᑕᴥ_8_ᴎɴ_ᗱᗴ_ᑐᑕᴥ_ᑐᑕ_ᴥᑐ_3)  # -> BasePlane, Radius, Angle
ᴎɴ_8_ᴎɴᴥᑐᑕᔓᔕᴎɴ_ᴎɴᔓᔕᑐᑕᴥ_8_ᴎɴ_ᗱᗴ_ᑐᑕᴥ_ᑐᑕ_ᴥᑐ_9 = ᴎɴ8ᴎɴᴥᑐᑕᔓᔕᴎɴᴎɴᔓᔕᑐᑕᴥ8ᴎɴᗱᗴᑐᑕᴥᑐᑕᴥᑐᑕᗱᗴᴎɴ8ᴎɴᴥᑐᑕᔓᔕᴎɴᴎɴᔓᔕᑐᑕᴥ8ᴎɴ(x=1, x_2=orient_39.Geometry, x_3=9)  # "◙ ᴎɴⓄ⊙✣8⊙ᴎɴᴥᑐᑕᔓᔕᴎɴ⊙ᴎɴᔓᔕᑐᑕᴥ⊙8✣⊙Ⓞᴎɴ◯ᗱᗴ◇ᑐᑕᴥ⊙ᑐᑕ⊙ᴥᑐᑕ◇ᗱᗴ◯ᴎɴⓄ⊙✣8⊙ᴎɴᴥᑐᑕᔓᔕᴎɴ⊙ᴎɴᔓᔕᑐᑕᴥ⊙8✣⊙Ⓞᴎɴ ◙"; disabled
deconstruct_arc_13 = DeconstructArc(Arc=ᴎɴ_8_ᴎɴᴥᑐᑕᔓᔕᴎɴ_ᴎɴᔓᔕᑐᑕᴥ_8_ᴎɴ_ᗱᗴ_ᑐᑕᴥ_ᑐᑕ_ᴥᑐ_4)  # -> BasePlane, Radius, Angle
move_10 = Move(Geometry=rotate_32.Geometry, Motion=vector_xyz_2.Vector)  # -> Geometry, Transform; disabled
ᴎɴ_8_ᴎɴᴥᑐᑕᔓᔕᴎɴ_ᴎɴᔓᔕᑐᑕᴥ_8_ᴎɴ_ᗱᗴ_ᑐᑕᴥ_ᑐᑕ_ᴥᑐ_10 = ᴎɴ8ᴎɴᴥᑐᑕᔓᔕᴎɴᴎɴᔓᔕᑐᑕᴥ8ᴎɴᗱᗴᑐᑕᴥᑐᑕᴥᑐᑕᗱᗴᴎɴ8ᴎɴᴥᑐᑕᔓᔕᴎɴᴎɴᔓᔕᑐᑕᴥ8ᴎɴ(x=1, x_2=orient_40.Geometry, x_3=9)  # "◙ ᴎɴⓄ⊙✣8⊙ᴎɴᴥᑐᑕᔓᔕᴎɴ⊙ᴎɴᔓᔕᑐᑕᴥ⊙8✣⊙Ⓞᴎɴ◯ᗱᗴ◇ᑐᑕᴥ⊙ᑐᑕ⊙ᴥᑐᑕ◇ᗱᗴ◯ᴎɴⓄ⊙✣8⊙ᴎɴᴥᑐᑕᔓᔕᴎɴ⊙ᴎɴᔓᔕᑐᑕᴥ⊙8✣⊙Ⓞᴎɴ ◙"; disabled
geometry_158 = Geometry(ᴎɴ_8_ᴎɴᴥᑐᑕᔓᔕᴎɴ_ᴎɴᔓᔕᑐᑕᴥ_8_ᴎɴ_ᗱᗴ_ᑐᑕᴥ_ᑐᑕ_ᴥᑐ_7)  # disabled
geometry_159 = Geometry(ᴎɴ_8_ᴎɴᴥᑐᑕᔓᔕᴎɴ_ᴎɴᔓᔕᑐᑕᴥ_8_ᴎɴ_ᗱᗴ_ᑐᑕᴥ_ᑐᑕ_ᴥᑐ_8)
geometry_160 = Geometry(ᴎɴ_8_ᴎɴᴥᑐᑕᔓᔕᴎɴ_ᴎɴᔓᔕᑐᑕᴥ_8_ᴎɴ_ᗱᗴ_ᑐᑕᴥ_ᑐᑕ_ᴥᑐ_9)
deconstruct_arc_14 = DeconstructArc(Arc=ᴎɴ_8_ᴎɴᴥᑐᑕᔓᔕᴎɴ_ᴎɴᔓᔕᑐᑕᴥ_8_ᴎɴ_ᗱᗴ_ᑐᑕᴥ_ᑐᑕ_ᴥᑐ_5)  # -> BasePlane, Radius, Angle
scale_210 = Scale(Geometry=rotate_35.Geometry, Center=area_31.Centroid, Factor=panel_2)  # -> Geometry, Transform; disabled
rotate_39 = Rotate(Geometry=orient_37.Geometry, Angle=degrees(30), Plane=area_45.Centroid)  # -> Geometry, Transform; disabled
deconstruct_arc_15 = DeconstructArc(Arc=ᴎɴ_8_ᴎɴᴥᑐᑕᔓᔕᴎɴ_ᴎɴᔓᔕᑐᑕᴥ_8_ᴎɴ_ᗱᗴ_ᑐᑕᴥ_ᑐᑕ_ᴥᑐ_6)  # -> BasePlane, Radius, Angle
ᴎɴ_8_ᴎɴᴥᑐᑕᔓᔕᴎɴ_ᴎɴᔓᔕᑐᑕᴥ_8_ᴎɴ_ᗱᗴ_ᑐᑕᴥ_ᑐᑕ_ᴥᑐ_11 = ᴎɴ8ᴎɴᴥᑐᑕᔓᔕᴎɴᴎɴᔓᔕᑐᑕᴥ8ᴎɴᗱᗴᑐᑕᴥᑐᑕᴥᑐᑕᗱᗴᴎɴ8ᴎɴᴥᑐᑕᔓᔕᴎɴᴎɴᔓᔕᑐᑕᴥ8ᴎɴ(x=1, x_2=orient_41.Geometry, x_3=9)  # "◙ ᴎɴⓄ⊙✣8⊙ᴎɴᴥᑐᑕᔓᔕᴎɴ⊙ᴎɴᔓᔕᑐᑕᴥ⊙8✣⊙Ⓞᴎɴ◯ᗱᗴ◇ᑐᑕᴥ⊙ᑐᑕ⊙ᴥᑐᑕ◇ᗱᗴ◯ᴎɴⓄ⊙✣8⊙ᴎɴᴥᑐᑕᔓᔕᴎɴ⊙ᴎɴᔓᔕᑐᑕᴥ⊙8✣⊙Ⓞᴎɴ ◙"; disabled
orient_49 = Orient(Geometry=graft(stream_filter_82), Source=list_item_36, Target=flatten(area_59.Centroid))  # -> Geometry, Transform
merge_78 = Merge(Data1=geometry_131, Data2=orient_49.Geometry)  # disabled
rotate_40 = Rotate(Geometry=orient_38.Geometry, Angle=degrees(30), Plane=area_46.Centroid)  # -> Geometry, Transform; disabled
rotate_41 = Rotate(Geometry=orient_39.Geometry, Angle=degrees(30), Plane=area_47.Centroid)  # -> Geometry, Transform; disabled
scale_211 = Scale(Geometry=rotate_36.Geometry, Center=center_17.Center, Factor=panel_3)  # -> Geometry, Transform; disabled
ᴎɴ_8_ᴎɴᴥᑐᑕᔓᔕᴎɴ_ᴎɴᔓᔕᑐᑕᴥ_8_ᴎɴ_ᗱᗴ_ᑐᑕᴥ_ᑐᑕ_ᴥᑐ_12 = ᴎɴ8ᴎɴᴥᑐᑕᔓᔕᴎɴᴎɴᔓᔕᑐᑕᴥ8ᴎɴᗱᗴᑐᑕᴥᑐᑕᴥᑐᑕᗱᗴᴎɴ8ᴎɴᴥᑐᑕᔓᔕᴎɴᴎɴᔓᔕᑐᑕᴥ8ᴎɴ(x=1, x_2=orient_42.Geometry, x_3=9)  # "◙ ᴎɴⓄ⊙✣8⊙ᴎɴᴥᑐᑕᔓᔕᴎɴ⊙ᴎɴᔓᔕᑐᑕᴥ⊙8✣⊙Ⓞᴎɴ◯ᗱᗴ◇ᑐᑕᴥ⊙ᑐᑕ⊙ᴥᑐᑕ◇ᗱᗴ◯ᴎɴⓄ⊙✣8⊙ᴎɴᴥᑐᑕᔓᔕᴎɴ⊙ᴎɴᔓᔕᑐᑕᴥ⊙8✣⊙Ⓞᴎɴ ◙"; disabled
geometry_161 = Geometry(ᴎɴ_8_ᴎɴᴥᑐᑕᔓᔕᴎɴ_ᴎɴᔓᔕᑐᑕᴥ_8_ᴎɴ_ᗱᗴ_ᑐᑕᴥ_ᑐᑕ_ᴥᑐ_10)  # disabled
rotate_42 = Rotate(Geometry=orient_40.Geometry, Angle=degrees(30), Plane=area_48.Centroid)  # -> Geometry, Transform; disabled
geometry_162 = Geometry(ᴎɴ_8_ᴎɴᴥᑐᑕᔓᔕᴎɴ_ᴎɴᔓᔕᑐᑕᴥ_8_ᴎɴ_ᗱᗴ_ᑐᑕᴥ_ᑐᑕ_ᴥᑐ_11)
scale_212 = Scale(Geometry=rotate_37.Geometry, Center=area_38.Centroid, Factor=panel_4)  # -> Geometry, Transform; disabled
scale_213 = Scale(Geometry=rotate_38.Geometry, Center=area_39.Centroid, Factor=panel_5)  # -> Geometry, Transform; disabled
ᴎɴ_8_ᴎɴᴥᑐᑕᔓᔕᴎɴ_ᴎɴᔓᔕᑐᑕᴥ_8_ᴎɴ_ᗱᗴ_ᑐᑕᴥ_ᑐᑕ_ᴥᑐ_13 = ᴎɴ8ᴎɴᴥᑐᑕᔓᔕᴎɴᴎɴᔓᔕᑐᑕᴥ8ᴎɴᗱᗴᑐᑕᴥᑐᑕᴥᑐᑕᗱᗴᴎɴ8ᴎɴᴥᑐᑕᔓᔕᴎɴᴎɴᔓᔕᑐᑕᴥ8ᴎɴ(x=1, x_2=orient_45.Geometry, x_3=9)  # "◙ ᴎɴⓄ⊙✣8⊙ᴎɴᴥᑐᑕᔓᔕᴎɴ⊙ᴎɴᔓᔕᑐᑕᴥ⊙8✣⊙Ⓞᴎɴ◯ᗱᗴ◇ᑐᑕᴥ⊙ᑐᑕ⊙ᴥᑐᑕ◇ᗱᗴ◯ᴎɴⓄ⊙✣8⊙ᴎɴᴥᑐᑕᔓᔕᴎɴ⊙ᴎɴᔓᔕᑐᑕᴥ⊙8✣⊙Ⓞᴎɴ ◙"; disabled
rotate_43 = Rotate(Geometry=orient_41.Geometry, Angle=degrees(30), Plane=area_49.Centroid)  # -> Geometry, Transform; disabled
geometry_163 = Geometry(ᴎɴ_8_ᴎɴᴥᑐᑕᔓᔕᴎɴ_ᴎɴᔓᔕᑐᑕᴥ_8_ᴎɴ_ᗱᗴ_ᑐᑕᴥ_ᑐᑕ_ᴥᑐ_12)
rotate_44 = Rotate(Geometry=stream_filter_80, Angle=degrees(60), Plane=PlaneXY(0, 0, 0))  # -> Geometry, Transform
deconstruct_arc_16 = DeconstructArc(Arc=ᴎɴ_8_ᴎɴᴥᑐᑕᔓᔕᴎɴ_ᴎɴᔓᔕᑐᑕᴥ_8_ᴎɴ_ᗱᗴ_ᑐᑕᴥ_ᑐᑕ_ᴥᑐ_7)  # -> BasePlane, Radius, Angle; disabled
deconstruct_arc_17 = DeconstructArc(Arc=ᴎɴ_8_ᴎɴᴥᑐᑕᔓᔕᴎɴ_ᴎɴᔓᔕᑐᑕᴥ_8_ᴎɴ_ᗱᗴ_ᑐᑕᴥ_ᑐᑕ_ᴥᑐ_8)  # -> BasePlane, Radius, Angle
deconstruct_arc_18 = DeconstructArc(Arc=ᴎɴ_8_ᴎɴᴥᑐᑕᔓᔕᴎɴ_ᴎɴᔓᔕᑐᑕᴥ_8_ᴎɴ_ᗱᗴ_ᑐᑕᴥ_ᑐᑕ_ᴥᑐ_9)  # -> BasePlane, Radius, Angle
rotate_45 = Rotate(Geometry=orient_42.Geometry, Angle=degrees(30), Plane=area_51.Centroid)  # -> Geometry, Transform; disabled
deconstruct_arc_19 = DeconstructArc(Arc=ᴎɴ_8_ᴎɴᴥᑐᑕᔓᔕᴎɴ_ᴎɴᔓᔕᑐᑕᴥ_8_ᴎɴ_ᗱᗴ_ᑐᑕᴥ_ᑐᑕ_ᴥᑐ_10)  # -> BasePlane, Radius, Angle; disabled
geometry_164 = Geometry(ᴎɴ_8_ᴎɴᴥᑐᑕᔓᔕᴎɴ_ᴎɴᔓᔕᑐᑕᴥ_8_ᴎɴ_ᗱᗴ_ᑐᑕᴥ_ᑐᑕ_ᴥᑐ_13)
rotate_46 = Rotate(Geometry=orient_45.Geometry, Angle=degrees(30), Plane=area_52.Centroid)  # -> Geometry, Transform; disabled
scale_214 = Scale(Geometry=rotate_39.Geometry, Center=area_45.Centroid, Factor=panel_6)  # -> Geometry, Transform; disabled
scale_215 = Scale(Geometry=rotate_40.Geometry, Center=area_46.Centroid, Factor=panel_7)  # -> Geometry, Transform; disabled
deconstruct_arc_20 = DeconstructArc(Arc=ᴎɴ_8_ᴎɴᴥᑐᑕᔓᔕᴎɴ_ᴎɴᔓᔕᑐᑕᴥ_8_ᴎɴ_ᗱᗴ_ᑐᑕᴥ_ᑐᑕ_ᴥᑐ_11)  # -> BasePlane, Radius, Angle
scale_216 = Scale(Geometry=rotate_41.Geometry, Center=area_47.Centroid, Factor=panel_8)  # -> Geometry, Transform; disabled
deconstruct_arc_21 = DeconstructArc(Arc=ᴎɴ_8_ᴎɴᴥᑐᑕᔓᔕᴎɴ_ᴎɴᔓᔕᑐᑕᴥ_8_ᴎɴ_ᗱᗴ_ᑐᑕᴥ_ᑐᑕ_ᴥᑐ_12)  # -> BasePlane, Radius, Angle
scale_217 = Scale(Geometry=rotate_42.Geometry, Center=area_48.Centroid, Factor=panel_9)  # -> Geometry, Transform; disabled
fast_loop_start_33 = FastLoopStart(Iterations=2, Data=move_10.Geometry)  # -> port, Counter, Data; disabled
deconstruct_arc_22 = DeconstructArc(Arc=ᴎɴ_8_ᴎɴᴥᑐᑕᔓᔕᴎɴ_ᴎɴᔓᔕᑐᑕᴥ_8_ᴎɴ_ᗱᗴ_ᑐᑕᴥ_ᑐᑕ_ᴥᑐ_13)  # -> BasePlane, Radius, Angle
scale_218 = Scale(Geometry=rotate_43.Geometry, Center=area_49.Centroid, Factor=panel_10)  # -> Geometry, Transform; disabled
ᴎɴ_8_ᴎɴᴥᑐᑕᔓᔕᴎɴ_ᴎɴᔓᔕᑐᑕᴥ_8_ᴎɴ_ᗱᗴ_ᑐᑕᴥ_ᑐᑕ_ᴥᑐ_14 = ᴎɴ8ᴎɴᴥᑐᑕᔓᔕᴎɴᴎɴᔓᔕᑐᑕᴥ8ᴎɴᗱᗴᑐᑕᴥᑐᑕᴥᑐᑕᗱᗴᴎɴ8ᴎɴᴥᑐᑕᔓᔕᴎɴᴎɴᔓᔕᑐᑕᴥ8ᴎɴ(x=1, x_2=orient_47.Geometry, x_3=9)  # "◙ ᴎɴⓄ⊙✣8⊙ᴎɴᴥᑐᑕᔓᔕᴎɴ⊙ᴎɴᔓᔕᑐᑕᴥ⊙8✣⊙Ⓞᴎɴ◯ᗱᗴ◇ᑐᑕᴥ⊙ᑐᑕ⊙ᴥᑐᑕ◇ᗱᗴ◯ᴎɴⓄ⊙✣8⊙ᴎɴᴥᑐᑕᔓᔕᴎɴ⊙ᴎɴᔓᔕᑐᑕᴥ⊙8✣⊙Ⓞᴎɴ ◙"; disabled
multiplication_25 = Multiplication(A=deconstruct_arc_16.Radius, B="729")  # disabled
scale_219 = Scale(Geometry=rotate_45.Geometry, Center=area_51.Centroid, Factor=panel_11)  # -> Geometry, Transform; disabled
ᴎɴ_8_ᴎɴᴥᑐᑕᔓᔕᴎɴ_ᴎɴᔓᔕᑐᑕᴥ_8_ᴎɴ_ᗱᗴ_ᑐᑕᴥ_ᑐᑕ_ᴥᑐ_15 = ᴎɴ8ᴎɴᴥᑐᑕᔓᔕᴎɴᴎɴᔓᔕᑐᑕᴥ8ᴎɴᗱᗴᑐᑕᴥᑐᑕᴥᑐᑕᗱᗴᴎɴ8ᴎɴᴥᑐᑕᔓᔕᴎɴᴎɴᔓᔕᑐᑕᴥ8ᴎɴ(x=1, x_2=orient_48.Geometry, x_3=9)  # "◙ ᴎɴⓄ⊙✣8⊙ᴎɴᴥᑐᑕᔓᔕᴎɴ⊙ᴎɴᔓᔕᑐᑕᴥ⊙8✣⊙Ⓞᴎɴ◯ᗱᗴ◇ᑐᑕᴥ⊙ᑐᑕ⊙ᴥᑐᑕ◇ᗱᗴ◯ᴎɴⓄ⊙✣8⊙ᴎɴᴥᑐᑕᔓᔕᴎɴ⊙ᴎɴᔓᔕᑐᑕᴥ⊙8✣⊙Ⓞᴎɴ ◙"; disabled
multiplication_26 = Multiplication(A=deconstruct_arc_19.Radius, B="54")  # disabled
scale_220 = Scale(Geometry=rotate_46.Geometry, Center=area_52.Centroid, Factor=panel_12)  # -> Geometry, Transform; disabled
geometry_165 = Geometry(ᴎɴ_8_ᴎɴᴥᑐᑕᔓᔕᴎɴ_ᴎɴᔓᔕᑐᑕᴥ_8_ᴎɴ_ᗱᗴ_ᑐᑕᴥ_ᑐᑕ_ᴥᑐ_14)
geometry_166 = Geometry(ᴎɴ_8_ᴎɴᴥᑐᑕᔓᔕᴎɴ_ᴎɴᔓᔕᑐᑕᴥ_8_ᴎɴ_ᗱᗴ_ᑐᑕᴥ_ᑐᑕ_ᴥᑐ_15)
rotate_47 = Rotate(Geometry=orient_47.Geometry, Angle=degrees(30), Plane=area_57.Centroid)  # -> Geometry, Transform; disabled
move_11 = Move(Geometry=rotate_44.Geometry, Motion=vector_xyz_4.Vector)  # -> Geometry, Transform
scale_221 = Scale(Geometry=fast_loop_start_33.Data, Center=construct_point_6, Factor=0.3333333333)  # -> Geometry, Transform; disabled
rotate_48 = Rotate(Geometry=orient_48.Geometry, Angle=degrees(30), Plane=area_58.Centroid)  # -> Geometry, Transform; disabled
ᴎɴ_8_ᴎɴᴥᑐᑕᔓᔕᴎɴ_ᴎɴᔓᔕᑐᑕᴥ_8_ᴎɴ_ᗱᗴ_ᑐᑕᴥ_ᑐᑕ_ᴥᑐ_16 = ᴎɴ8ᴎɴᴥᑐᑕᔓᔕᴎɴᴎɴᔓᔕᑐᑕᴥ8ᴎɴᗱᗴᑐᑕᴥᑐᑕᴥᑐᑕᗱᗴᴎɴ8ᴎɴᴥᑐᑕᔓᔕᴎɴᴎɴᔓᔕᑐᑕᴥ8ᴎɴ(x=1, x_2=orient_49.Geometry, x_3=9)  # "◙ ᴎɴⓄ⊙✣8⊙ᴎɴᴥᑐᑕᔓᔕᴎɴ⊙ᴎɴᔓᔕᑐᑕᴥ⊙8✣⊙Ⓞᴎɴ◯ᗱᗴ◇ᑐᑕᴥ⊙ᑐᑕ⊙ᴥᑐᑕ◇ᗱᗴ◯ᴎɴⓄ⊙✣8⊙ᴎɴᴥᑐᑕᔓᔕᴎɴ⊙ᴎɴᔓᔕᑐᑕᴥ⊙8✣⊙Ⓞᴎɴ ◙"; disabled
deconstruct_arc_23 = DeconstructArc(Arc=ᴎɴ_8_ᴎɴᴥᑐᑕᔓᔕᴎɴ_ᴎɴᔓᔕᑐᑕᴥ_8_ᴎɴ_ᗱᗴ_ᑐᑕᴥ_ᑐᑕ_ᴥᑐ_14)  # -> BasePlane, Radius, Angle
deconstruct_arc_24 = DeconstructArc(Arc=ᴎɴ_8_ᴎɴᴥᑐᑕᔓᔕᴎɴ_ᴎɴᔓᔕᑐᑕᴥ_8_ᴎɴ_ᗱᗴ_ᑐᑕᴥ_ᑐᑕ_ᴥᑐ_15)  # -> BasePlane, Radius, Angle
geometry_167 = Geometry(ᴎɴ_8_ᴎɴᴥᑐᑕᔓᔕᴎɴ_ᴎɴᔓᔕᑐᑕᴥ_8_ᴎɴ_ᗱᗴ_ᑐᑕᴥ_ᑐᑕ_ᴥᑐ_16)
rotate_49 = Rotate(Geometry=orient_49.Geometry, Angle=degrees(30), Plane=area_59.Centroid)  # -> Geometry, Transform; disabled
scale_222 = Scale(Geometry=rotate_47.Geometry, Center=area_57.Centroid, Factor=panel_13)  # -> Geometry, Transform; disabled
scale_223 = Scale(Geometry=rotate_48.Geometry, Center=area_58.Centroid, Factor=panel_14)  # -> Geometry, Transform; disabled
fast_loop_end_33 = FastLoopEnd(port=fast_loop_start_33.port, Exit=False, Data=scale_221.Geometry, RecordData=True, TimeOutVal=0)  # disabled
merge_79 = Merge(Data1=move_10.Geometry, Data2=fast_loop_end_33)  # disabled
polar_array_12 = PolarArray(Geometry=merge_79, Plane=PlaneXY(0, 0, 0), Count=6, Angle=6.283185307)  # -> Geometry, Transform; disabled
deconstruct_arc_25 = DeconstructArc(Arc=ᴎɴ_8_ᴎɴᴥᑐᑕᔓᔕᴎɴ_ᴎɴᔓᔕᑐᑕᴥ_8_ᴎɴ_ᗱᗴ_ᑐᑕᴥ_ᑐᑕ_ᴥᑐ_16)  # -> BasePlane, Radius, Angle
scale_224 = Scale(Geometry=rotate_49.Geometry, Center=area_59.Centroid, Factor=panel_15)  # -> Geometry, Transform; disabled
merge_80 = Merge(Data1=move_6.Geometry, Data2=move_9.Geometry, Data3=move_11.Geometry)
polar_array_13 = PolarArray(Geometry=merge_80, Plane=PlaneXY(0, 0, 0), Count=6, Angle=6.283185307)  # -> Geometry, Transform
geometry_168 = Geometry(flatten(polar_array_13.Geometry))  # disabled
area_82 = Area(Geometry=geometry_168)  # -> Area, Centroid; disabled
geometry_169 = Geometry(area_82.Centroid)  # disabled

merge_81 = Merge(
    Data1=orient_30.Geometry,
    Data2=orient_29.Geometry,
    Data3=orient_34.Geometry,
    Data4=orient_33.Geometry,
    Data5=orient_38.Geometry,
    Data6=orient_39.Geometry,
    Data7=orient_45.Geometry,
    Data8=orient_35.Geometry,
    Data9=orient_37.Geometry,
    Data10=orient_41.Geometry,
    Data11=orient_42.Geometry,
    Data12=orient_40.Geometry,
    Data13=orient_48.Geometry,
    Data14=orient_47.Geometry,
    Data15=orient_49.Geometry)  # -> flatten(Result)
collision_one_many_6 = CollisionOneMany(Collider=merge_81, Obstacles=flatten(boundary_surfaces_9))  # -> Collision, Index; disabled
cull_pattern_10 = CullPattern(List=merge_81, CullPattern=invert(collision_one_many_6.Collision))

merge_82 = Merge(
    Data1=stream_filter_52,
    Data2=orient_30.Geometry,
    Data3=orient_29.Geometry,
    Data4=orient_34.Geometry,
    Data5=orient_33.Geometry,
    Data6=orient_38.Geometry,
    Data7=orient_39.Geometry,
    Data8=orient_45.Geometry,
    Data9=orient_35.Geometry,
    Data10=orient_37.Geometry,
    Data11=orient_41.Geometry,
    Data12=orient_42.Geometry,
    Data13=orient_40.Geometry,
    Data14=orient_48.Geometry,
    Data15=orient_47.Geometry,
    Data16=orient_49.Geometry,
    Data17=polar_array_13.Geometry)  # -> flatten(Result)
rotate_50 = Rotate(Geometry=merge_82, Angle=degrees(30), Plane=PlaneXY(0, 0, 0))  # -> Geometry, Transform; disabled
geometry_170 = Geometry(flatten(merge_82))
stroke_8 = Stroke(ShapeGeometry=geometry_170, Color=RGB(0, 244, 124), Weight=0, EndCap=0)
solid_fill_7 = SolidFill(ShapeGeometry=stroke_8, Color=RGB(0, 244, 124))
data = Data(reverse(solid_fill_7))
merge_83 = Merge(Data1=data, Data2=solid_fill_4, Data3=solid_fill_3, Data4=stroke_5)  # -> reverse(Result)
shape_data_3 = ShapeData(ShapeGeometry=merge_83, ID=" ", Hover=False)
construct_drawing_3 = ConstructDrawing(
    ShapesGeometry=flatten(shape_data_3),
    Boundary=bounding_rectangle_2,
    Width=multiplication_24,
    Height=multiplication_24,
    Color=RGBA(255, 255, 255, 0))  # -> Drawing, Boundary
save_svg_3 = SaveSvg(DrawingsShapesGeometry=construct_drawing_3.Drawing, FolderPath="C:\", FileName="ϱvƨ", Save=True)
drawing_viewer_3 = DrawingViewer(DrawingsShapesGeometry=construct_drawing_3.Drawing, Resolution=96)

# ==== cluster ᴎɴ8ᴎɴᴥᑐᑕᔓᔕᴎɴᴎɴᔓᔕᑐᑕᴥ8ᴎɴᗱᗴᑐᑕᴥᑐᑕᴥᑐᑕᗱᗴᴎɴ8ᴎɴᴥᑐᑕᔓᔕᴎɴᴎɴᔓᔕᑐᑕᴥ8ᴎɴ: ◙ ᴎɴⓄ⊙✣8⊙ᴎɴᴥᑐᑕᔓᔕᴎɴ⊙ᴎɴᔓᔕᑐᑕᴥ⊙8✣⊙Ⓞᴎɴ◯ᗱᗴ◇ᑐᑕᴥ⊙ᑐᑕ⊙ᴥᑐᑕ◇ᗱᗴ◯ᴎɴⓄ⊙✣8⊙ᴎɴᴥᑐᑕᔓᔕᴎɴ⊙ᴎɴᔓᔕᑐᑕᴥ⊙8✣⊙Ⓞᴎɴ ◙ ᴎɴⓄ⊙✣8⊙ᴎɴᴥᑐᑕᔓᔕᴎɴ⊙ᴎɴᔓᔕᑐᑕᴥ⊙8✣⊙Ⓞᴎɴ◯ᗱᗴ◇ᑐᑕᴥ⊙ᑐᑕ⊙ᴥᑐᑕ◇ᗱᗴ◯ᴎɴⓄ⊙✣8⊙ᴎɴᴥᑐᑕᔓᔕᴎɴ⊙ᴎɴᔓᔕᑐᑕᴥ⊙8✣⊙Ⓞᴎɴ ◙
x = ClusterInput()
integer = Integer(x)
circle = Circle(Plane=PlaneXY(0, 0, 0), Radius=0.5)  # disabled
series = Series(Start=2, Step=1, Count=1)  # disabled
curve_display = CurveDisplay(Curves=circle, Thickness=2, Color=RGB(0, 244, 124))  # disabled
power_of_2 = PowerOf2(Value=series)  # disabled
circumscribed_polygon = CircumscribedPolygon(Plane=PlaneXY(0, 0, 0), Radius=0.5, Sides=power_of_2)  # disabled
curve_display_2 = CurveDisplay(Curves=circumscribed_polygon, Thickness=2, Color=RGB(255, 11, 131))  # disabled
merge = Merge(Data1=circumscribed_polygon, Data2=circle)  # disabled
x_2 = ClusterInput()
planarize_curve = PlanarizeCurve(Curve=x_2)  # -> PlanarCurve, Plane, Deviation; disabled
explode = Explode(Curve=x_2, Recursive=True)  # -> Segments, Vertices
curve_display_3 = CurveDisplay(Curves=explode.Segments, Thickness=1, Color=RGB(255, 11, 131))
null_placeholder = NullPlaceholder()
x_3 = ClusterInput()
number = Number(x_3)
power = Power(A="3", B=number)
scale = Scale(Geometry=explode.Segments, Center=Point(0, 0, 0), Factor=power)  # -> Geometry, Transform
list_item = ListItem(List=scale.Geometry, Index=0, Wrap=True)  # -> Item, Item1, Item2
curve_middle = CurveMiddle(Curve=list_item.Item2)
curve_middle_2 = CurveMiddle(Curve=list_item.Item1)
curve_middle_3 = CurveMiddle(Curve=list_item.Item)
deconstruct = Deconstruct(Point=curve_middle_2)  # -> XComponent, YComponent, ZComponent; disabled
deconstruct_2 = Deconstruct(Point=curve_middle_3)  # -> XComponent, YComponent, ZComponent; disabled
deconstruct_3 = Deconstruct(Point=curve_middle)  # -> XComponent, YComponent, ZComponent; disabled
merge_2 = Merge(Data1=curve_middle_3, Data2=curve_middle_2, Data3=curve_middle)
merge_3 = Merge(Data1=deconstruct_2.XComponent, Data2=deconstruct.XComponent, Data3=deconstruct_3.XComponent)  # disabled
centroid = Centroid(PointA=curve_middle_3, PointB=curve_middle_2, PointC=curve_middle)  # -> Centroid, MedianAB, MedianBC, MedianCA; disabled
merge_4 = Merge(Data1=deconstruct_2.YComponent, Data2=deconstruct.YComponent, Data3=deconstruct_3.YComponent)  # disabled
merge_5 = Merge(Data1=deconstruct_2.ZComponent, Data2=deconstruct.ZComponent, Data3=deconstruct_3.ZComponent)  # disabled
circumcentre = Circumcentre(PointA=curve_middle_3, PointB=curve_middle_2, PointC=curve_middle)  # -> Circumcentre, BisectorAB, BisectorBC, BisectorCA; disabled
average = Average(Input=merge_2)
circle_tantantan = CircleTanTanTan(CurveA=list_item.Item, CurveB=list_item.Item1, CurveC=list_item.Item2, Point=average)  # -> flatten(Circle)
scale_2 = Scale(Geometry=circle_tantantan, Center=Point(0, 0, 0), Factor=expr("1/X", power))  # -> Geometry, Transform
null_item = NullItem(Item=scale_2.Geometry)  # -> NullFlags, InvalidFlags, Description
subtraction = Subtraction(A="1", B=null_item.NullFlags)
stream_filter = StreamFilter(Gate=integer, Stream0=null_item.NullFlags, Stream1=subtraction)
stream_gate = StreamGate(Stream=explode.Vertices, Gate=stream_filter)
stream_gate_2 = StreamGate(Stream=x_2, Gate=stream_filter)
cull_duplicates = CullDuplicates(Points=stream_gate, Tolerance=7.629394531e-06, CullMode=1)  # -> Points, Indices, Valence
nurbs_curve = NurbsCurve(Vertices=cull_duplicates.Points, Degree=1, Periodic=True)  # -> flatten(Curve), Length, Domain
area = Area(Geometry=stream_gate_2)  # -> Area, Centroid
curve_closest_point = CurveClosestPoint(Point=area.Centroid, Curve=flatten(nurbs_curve.Curve))  # -> Point, Parameter, Distance
planar = Planar(Curve=nurbs_curve.Curve)  # -> Planar, Plane, Deviation
circle_cnr = CircleCNR(Center=flatten(area.Centroid), Normal=flatten(planar.Plane), Radius=flatten(curve_closest_point.Distance))
stream_filter_2 = StreamFilter(Gate=stream_filter, Stream0=circle_cnr, Stream1=scale_2.Geometry)
geometry = Geometry(stream_filter_2)
curve_display_4 = CurveDisplay(Curves=geometry, Thickness=1, Color=RGB(0, 244, 124))
x_4 = ClusterOutput(geometry)
average_2 = Average(Input=merge_4)  # disabled
average_3 = Average(Input=merge_3)  # disabled
average_4 = Average(Input=merge_5)  # disabled
orthocentre = Orthocentre(PointA=curve_middle_3, PointB=curve_middle_2, PointC=curve_middle)  # -> Orthocentre, AltitudeAB, AltitudeBC, AltitudeCA; disabled
dotdisplay = DotDisplay(Point=circumcentre.Circumcentre)  # disabled
construct_point = ConstructPoint(XCoordinate=average_3, YCoordinate=average_2, ZCoordinate=average_4)  # disabled
incentre = Incentre(PointA=curve_middle_3, PointB=curve_middle_2, PointC=curve_middle)  # -> Incentre, BisectorA, BisectorB, BisectorC; disabled
