# Grasshopper definition XHꓨ. ꙮ◦୦◦◯◦୦◦🕛፨🕛◦୦◦◯◦୦◦𝆯 𝆯◦୦◦◯◦୦◦🕛፨🕛◦୦◦◯◦୦◦ꙮ .GHX (Grasshopper 1.0.7)
# plug-ins: Anemone, GraphicPlus, BlueOrange

geometry = Geometry(Tree({0;0;0}: [{Plane=PlaneXY(0, 0.3333333333, 0), Radius=0.05555555556}, {Plane=PlaneXY(-0.2886751354, 0.1666666652, 0), Radius=0.05555555556}, {Plane=PlaneXY(-0.2886751355, -0.1666666651, 0), Radius=0.05555555556}, {Plane=PlaneXY(0, -0.3333333333, 0), Radius=0.05555555556}, {Plane=PlaneXY(0.2886751354, -0.1666666652, 0), Radius=0.05555555556}, {Plane=PlaneXY(0.2886751355, 0.1666666651, 0), Radius=0.05555555556}], {1;0;0;0}: [{Plane=PlaneXY(0, 0.4444444444, 0), Radius=0.01851851852}, {Plane=PlaneXY(-0.2886751354, 0.2777777763, 0), Radius=0.01851851852}, {Plane=PlaneXY(-0.2886751355, -0.05555555396, 0), Radius=0.01851851852}, {Plane=PlaneXY(0, -0.2222222222, 0), Radius=0.01851851852}, {Plane=PlaneXY(0.2886751354, -0.05555555412, 0), Radius=0.01851851852}, {Plane=PlaneXY(0.2886751355, 0.2777777762, 0), Radius=0.01851851852}], {1;0;0;1}: [{Plane=PlaneXY(-0.09622504514, 0.3888888884, 0), Radius=0.01851851852}, {Plane=PlaneXY(-0.3849001806, 0.2222222203, 0), Radius=0.01851851852}, {Plane=PlaneXY(-0.3849001807, -0.11111111, 0), Radius=0.01851851852}, {Plane=PlaneXY(-0.09622504514, -0.2777777783, 0), Radius=0.01851851852}, {Plane=PlaneXY(0.1924500903, -0.1111111102, 0), Radius=0.01851851852}, {Plane=PlaneXY(0.1924500904, 0.2222222201, 0), Radius=0.01851851852}], {1;0;0;2}: [{Plane=PlaneXY(-0.09622504517, 0.2777777783, 0), Radius=0.01851851852}, {Plane=PlaneXY(-0.3849001806, 0.1111111102, 0), Radius=0.01851851852}, {Plane=PlaneXY(-0.3849001807, -0.2222222201, 0), Radius=0.01851851852}, {Plane=PlaneXY(-0.09622504517, -0.3888888884, 0), Radius=0.01851851852}, {Plane=PlaneXY(0.1924500903, -0.2222222203, 0), Radius=0.01851851852}, {Plane=PlaneXY(0.1924500903, 0.11111111, 0), Radius=0.01851851852}], {1;0;0;3}: [{Plane=PlaneXY(0, 0.2222222222, 0), Radius=0.01851851852}, {Plane=PlaneXY(-0.2886751354, 0.05555555412, 0), Radius=0.01851851852}, {Plane=PlaneXY(-0.2886751355, -0.2777777762, 0), Radius=0.01851851852}, {Plane=PlaneXY(0, -0.4444444444, 0), Radius=0.01851851852}, {Plane=PlaneXY(0.2886751354, -0.2777777763, 0), Radius=0.01851851852}, {Plane=PlaneXY(0.2886751355, 0.05555555396, 0), Radius=0.01851851852}], {1;0;0;4}: [{Plane=PlaneXY(0.09622504514, 0.2777777783, 0), Radius=0.01851851852}, {Plane=PlaneXY(-0.1924500903, 0.1111111102, 0), Radius=0.01851851852}, {Plane=PlaneXY(-0.1924500904, -0.2222222201, 0), Radius=0.01851851852}, {Plane=PlaneXY(0.09622504514, -0.3888888884, 0), Radius=0.01851851852}, {Plane=PlaneXY(0.3849001806, -0.2222222203, 0), Radius=0.01851851852}, {Plane=PlaneXY(0.3849001807, 0.11111111, 0), Radius=0.01851851852}]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))
geometry_2 = Geometry(Tree({0;0;0}: [{Plane=PlaneXY(0, 0.3333333333, 0), Radius=0.05555555556}, {Plane=PlaneXY(-0.2886751354, 0.1666666652, 0), Radius=0.05555555556}, {Plane=PlaneXY(-0.2886751355, -0.1666666651, 0), Radius=0.05555555556}, {Plane=PlaneXY(0, -0.3333333333, 0), Radius=0.05555555556}, {Plane=PlaneXY(0.2886751354, -0.1666666652, 0), Radius=0.05555555556}, {Plane=PlaneXY(0.2886751355, 0.1666666651, 0), Radius=0.05555555556}], {1;0;0;0}: [{Plane=PlaneXY(0, 0.4444444444, 0), Radius=0.01851851852}, {Plane=PlaneXY(-0.2886751354, 0.2777777763, 0), Radius=0.01851851852}, {Plane=PlaneXY(-0.2886751355, -0.05555555396, 0), Radius=0.01851851852}, {Plane=PlaneXY(0, -0.2222222222, 0), Radius=0.01851851852}, {Plane=PlaneXY(0.2886751354, -0.05555555412, 0), Radius=0.01851851852}, {Plane=PlaneXY(0.2886751355, 0.2777777762, 0), Radius=0.01851851852}], {1;0;0;1}: [{Plane=PlaneXY(-0.09622504514, 0.3888888884, 0), Radius=0.01851851852}, {Plane=PlaneXY(-0.3849001806, 0.2222222203, 0), Radius=0.01851851852}, {Plane=PlaneXY(-0.3849001807, -0.11111111, 0), Radius=0.01851851852}, {Plane=PlaneXY(-0.09622504514, -0.2777777783, 0), Radius=0.01851851852}, {Plane=PlaneXY(0.1924500903, -0.1111111102, 0), Radius=0.01851851852}, {Plane=PlaneXY(0.1924500904, 0.2222222201, 0), Radius=0.01851851852}], {1;0;0;2}: [{Plane=PlaneXY(-0.09622504517, 0.2777777783, 0), Radius=0.01851851852}, {Plane=PlaneXY(-0.3849001806, 0.1111111102, 0), Radius=0.01851851852}, {Plane=PlaneXY(-0.3849001807, -0.2222222201, 0), Radius=0.01851851852}, {Plane=PlaneXY(-0.09622504517, -0.3888888884, 0), Radius=0.01851851852}, {Plane=PlaneXY(0.1924500903, -0.2222222203, 0), Radius=0.01851851852}, {Plane=PlaneXY(0.1924500903, 0.11111111, 0), Radius=0.01851851852}], {1;0;0;3}: [{Plane=PlaneXY(0, 0.2222222222, 0), Radius=0.01851851852}, {Plane=PlaneXY(-0.2886751354, 0.05555555412, 0), Radius=0.01851851852}, {Plane=PlaneXY(-0.2886751355, -0.2777777762, 0), Radius=0.01851851852}, {Plane=PlaneXY(0, -0.4444444444, 0), Radius=0.01851851852}, {Plane=PlaneXY(0.2886751354, -0.2777777763, 0), Radius=0.01851851852}, {Plane=PlaneXY(0.2886751355, 0.05555555396, 0), Radius=0.01851851852}], {1;0;0;4}: [{Plane=PlaneXY(0.09622504514, 0.2777777783, 0), Radius=0.01851851852}, {Plane=PlaneXY(-0.1924500903, 0.1111111102, 0), Radius=0.01851851852}, {Plane=PlaneXY(-0.1924500904, -0.2222222201, 0), Radius=0.01851851852}, {Plane=PlaneXY(0.09622504514, -0.3888888884, 0), Radius=0.01851851852}, {Plane=PlaneXY(0.3849001806, -0.2222222203, 0), Radius=0.01851851852}, {Plane=PlaneXY(0.3849001807, 0.11111111, 0), Radius=0.01851851852}]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))
geometry_3 = Geometry(Tree({0;0;0}: [{Plane=PlaneXY(0, 0.3333333333, 0), Radius=0.05555555556}, {Plane=PlaneXY(-0.2886751354, 0.1666666652, 0), Radius=0.05555555556}, {Plane=PlaneXY(-0.2886751355, -0.1666666651, 0), Radius=0.05555555556}, {Plane=PlaneXY(0, -0.3333333333, 0), Radius=0.05555555556}, {Plane=PlaneXY(0.2886751354, -0.1666666652, 0), Radius=0.05555555556}, {Plane=PlaneXY(0.2886751355, 0.1666666651, 0), Radius=0.05555555556}], {1;0;0;0}: [{Plane=PlaneXY(0, 0.4444444444, 0), Radius=0.01851851852}, {Plane=PlaneXY(-0.2886751354, 0.2777777763, 0), Radius=0.01851851852}, {Plane=PlaneXY(-0.2886751355, -0.05555555396, 0), Radius=0.01851851852}, {Plane=PlaneXY(0, -0.2222222222, 0), Radius=0.01851851852}, {Plane=PlaneXY(0.2886751354, -0.05555555412, 0), Radius=0.01851851852}, {Plane=PlaneXY(0.2886751355, 0.2777777762, 0), Radius=0.01851851852}], {1;0;0;1}: [{Plane=PlaneXY(-0.09622504514, 0.3888888884, 0), Radius=0.01851851852}, {Plane=PlaneXY(-0.3849001806, 0.2222222203, 0), Radius=0.01851851852}, {Plane=PlaneXY(-0.3849001807, -0.11111111, 0), Radius=0.01851851852}, {Plane=PlaneXY(-0.09622504514, -0.2777777783, 0), Radius=0.01851851852}, {Plane=PlaneXY(0.1924500903, -0.1111111102, 0), Radius=0.01851851852}, {Plane=PlaneXY(0.1924500904, 0.2222222201, 0), Radius=0.01851851852}], {1;0;0;2}: [{Plane=PlaneXY(-0.09622504517, 0.2777777783, 0), Radius=0.01851851852}, {Plane=PlaneXY(-0.3849001806, 0.1111111102, 0), Radius=0.01851851852}, {Plane=PlaneXY(-0.3849001807, -0.2222222201, 0), Radius=0.01851851852}, {Plane=PlaneXY(-0.09622504517, -0.3888888884, 0), Radius=0.01851851852}, {Plane=PlaneXY(0.1924500903, -0.2222222203, 0), Radius=0.01851851852}, {Plane=PlaneXY(0.1924500903, 0.11111111, 0), Radius=0.01851851852}], {1;0;0;3}: [{Plane=PlaneXY(0, 0.2222222222, 0), Radius=0.01851851852}, {Plane=PlaneXY(-0.2886751354, 0.05555555412, 0), Radius=0.01851851852}, {Plane=PlaneXY(-0.2886751355, -0.2777777762, 0), Radius=0.01851851852}, {Plane=PlaneXY(0, -0.4444444444, 0), Radius=0.01851851852}, {Plane=PlaneXY(0.2886751354, -0.2777777763, 0), Radius=0.01851851852}, {Plane=PlaneXY(0.2886751355, 0.05555555396, 0), Radius=0.01851851852}], {1;0;0;4}: [{Plane=PlaneXY(0.09622504514, 0.2777777783, 0), Radius=0.01851851852}, {Plane=PlaneXY(-0.1924500903, 0.1111111102, 0), Radius=0.01851851852}, {Plane=PlaneXY(-0.1924500904, -0.2222222201, 0), Radius=0.01851851852}, {Plane=PlaneXY(0.09622504514, -0.3888888884, 0), Radius=0.01851851852}, {Plane=PlaneXY(0.3849001806, -0.2222222203, 0), Radius=0.01851851852}, {Plane=PlaneXY(0.3849001807, 0.11111111, 0), Radius=0.01851851852}]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))
geometry_4 = Geometry(Tree({0;0;0}: [{Plane=PlaneXY(0, 0.3333333333, 0), Radius=0.05555555556}, {Plane=PlaneXY(-0.2886751354, 0.1666666652, 0), Radius=0.05555555556}, {Plane=PlaneXY(-0.2886751355, -0.1666666651, 0), Radius=0.05555555556}, {Plane=PlaneXY(0, -0.3333333333, 0), Radius=0.05555555556}, {Plane=PlaneXY(0.2886751354, -0.1666666652, 0), Radius=0.05555555556}, {Plane=PlaneXY(0.2886751355, 0.1666666651, 0), Radius=0.05555555556}], {1;0;0;0}: [{Plane=PlaneXY(0, 0.4444444444, 0), Radius=0.01851851852}, {Plane=PlaneXY(-0.2886751354, 0.2777777763, 0), Radius=0.01851851852}, {Plane=PlaneXY(-0.2886751355, -0.05555555396, 0), Radius=0.01851851852}, {Plane=PlaneXY(0, -0.2222222222, 0), Radius=0.01851851852}, {Plane=PlaneXY(0.2886751354, -0.05555555412, 0), Radius=0.01851851852}, {Plane=PlaneXY(0.2886751355, 0.2777777762, 0), Radius=0.01851851852}], {1;0;0;1}: [{Plane=PlaneXY(-0.09622504514, 0.3888888884, 0), Radius=0.01851851852}, {Plane=PlaneXY(-0.3849001806, 0.2222222203, 0), Radius=0.01851851852}, {Plane=PlaneXY(-0.3849001807, -0.11111111, 0), Radius=0.01851851852}, {Plane=PlaneXY(-0.09622504514, -0.2777777783, 0), Radius=0.01851851852}, {Plane=PlaneXY(0.1924500903, -0.1111111102, 0), Radius=0.01851851852}, {Plane=PlaneXY(0.1924500904, 0.2222222201, 0), Radius=0.01851851852}], {1;0;0;2}: [{Plane=PlaneXY(-0.09622504517, 0.2777777783, 0), Radius=0.01851851852}, {Plane=PlaneXY(-0.3849001806, 0.1111111102, 0), Radius=0.01851851852}, {Plane=PlaneXY(-0.3849001807, -0.2222222201, 0), Radius=0.01851851852}, {Plane=PlaneXY(-0.09622504517, -0.3888888884, 0), Radius=0.01851851852}, {Plane=PlaneXY(0.1924500903, -0.2222222203, 0), Radius=0.01851851852}, {Plane=PlaneXY(0.1924500903, 0.11111111, 0), Radius=0.01851851852}], {1;0;0;3}: [{Plane=PlaneXY(0, 0.2222222222, 0), Radius=0.01851851852}, {Plane=PlaneXY(-0.2886751354, 0.05555555412, 0), Radius=0.01851851852}, {Plane=PlaneXY(-0.2886751355, -0.2777777762, 0), Radius=0.01851851852}, {Plane=PlaneXY(0, -0.4444444444, 0), Radius=0.01851851852}, {Plane=PlaneXY(0.2886751354, -0.2777777763, 0), Radius=0.01851851852}, {Plane=PlaneXY(0.2886751355, 0.05555555396, 0), Radius=0.01851851852}], {1;0;0;4}: [{Plane=PlaneXY(0.09622504514, 0.2777777783, 0), Radius=0.01851851852}, {Plane=PlaneXY(-0.1924500903, 0.1111111102, 0), Radius=0.01851851852}, {Plane=PlaneXY(-0.1924500904, -0.2222222201, 0), Radius=0.01851851852}, {Plane=PlaneXY(0.09622504514, -0.3888888884, 0), Radius=0.01851851852}, {Plane=PlaneXY(0.3849001806, -0.2222222203, 0), Radius=0.01851851852}, {Plane=PlaneXY(0.3849001807, 0.11111111, 0), Radius=0.01851851852}], {1;0;0;5}: [{Plane=PlaneXY(0.09622504517, 0.3888888884, 0), Radius=0.01851851852}, {Plane=PlaneXY(-0.1924500903, 0.2222222203, 0), Radius=0.01851851852}, {Plane=PlaneXY(-0.1924500903, -0.11111111, 0), Radius=0.01851851852}, {Plane=PlaneXY(0.09622504517, -0.2777777783, 0), Radius=0.01851851852}, {Plane=PlaneXY(0.3849001806, -0.1111111102, 0), Radius=0.01851851852}, {Plane=PlaneXY(0.3849001807, 0.2222222201, 0), Radius=0.01851851852}]))
geometry_5 = Geometry([{Plane=PlaneXY(0, 0.3333333333, 0), Radius=0.05555555556}, {Plane=PlaneXY(-0.2886751354, 0.1666666652, 0), Radius=0.05555555556}, {Plane=PlaneXY(-0.2886751355, -0.1666666651, 0), Radius=0.05555555556}, {Plane=PlaneXY(0, -0.3333333333, 0), Radius=0.05555555556}, {Plane=PlaneXY(0.2886751354, -0.1666666652, 0), Radius=0.05555555556}, {Plane=PlaneXY(0.2886751355, 0.1666666651, 0), Radius=0.05555555556}])
scale = Scale(Geometry=geometry_3, Center=Point(0, 0, 0), Factor=expr("3^-1", 1))  # -> Geometry, Transform
scale_2 = Scale(Geometry=geometry, Center=Point(0, 0, 0), Factor=1)  # -> Geometry, Transform
scale_3 = Scale(Geometry=geometry_2, Center=Point(0, 0, 0), Factor=expr("3^-2", 1))  # -> Geometry, Transform
scale_4 = Scale(Geometry=geometry_4, Center=Point(0, 0, 0), Factor=expr("3^-3", 1))  # -> Geometry, Transform
scale_5 = Scale(Geometry=geometry_5, Center=Point(0, 0, 0), Factor=expr("3^-4", 1))  # -> Geometry, Transform
division = Division(A=Slider(1, range=0..1), B=2)
circle = Circle(Plane=PlaneXY(0, 0, 0), Radius=division)
rotate = Rotate(Geometry=circle, Angle=degrees(90), Plane=PlaneXY(0, 0, 0))  # -> Geometry, Transform
scale_6 = Scale(Geometry=circle, Center=Point(0, 0, 0), Factor=expr("1/3", 0.3333333333))  # -> Geometry, Transform
expression = Expression(Expression="(256-256/3^3)-1")
merge = Merge(Data1=scale_2.Geometry, Data2=scale.Geometry, Data3=scale_3.Geometry, Data4=scale_4.Geometry, Data5=scale_5.Geometry)
bounding_rectangle = BoundingRectangle(Content=circle, Plane=PlaneXY(0, 0, 0))
evaluate_length = EvaluateLength(Curve=rotate.Geometry, Length=0, Normalized=True)  # -> Point, Tangent, Parameter
digit_scroller = DigitScroller(Scroller_Digits=12, Scroller_Prefix="Digit Scroller", Scroller_Radix=11, Scroller_Value=5)
divide_curve = DivideCurve(Curve=rotate.Geometry, Count=6, Kinks=False)  # -> Points, Tangents, Parameters
colour_rgb = ColourRGB(Alpha=255, Red=expression, Green=expression, Blue=expression)
geometry_6 = Geometry(merge)
subtraction = Subtraction(A=digit_scroller, B=1)
fast_loop_start = FastLoopStart(Iterations=subtraction, Data=scale_6.Geometry)  # -> port, Counter, Data
stream_filter = StreamFilter(Gate=Toggle(False), Stream0=evaluate_length.Point, Stream1=divide_curve.Points)
scale_7 = Scale(Geometry=graft(fast_loop_start.Data), Center=flatten(stream_filter), Factor=expr("1/3", 0.3333333333))  # -> Geometry, Transform
stroke = Stroke(ShapeGeometry=geometry_6, Color=colour_rgb, Weight=0, EndCap=2)
solid_fill = SolidFill(ShapeGeometry=stroke, Color=colour_rgb)  # -> flatten(Shape)
digit_scroller_2 = DigitScroller(Scroller_Digits=12, Scroller_Prefix="Digit Scroller", Scroller_Radix=11, Scroller_Value=6)
fast_loop_end = FastLoopEnd(port=fast_loop_start.port, Exit=False, Data=scale_7.Geometry, RecordData=True, TimeOutVal=0)
geometry_7 = Geometry(fast_loop_end)
power = Power(A="3", B=digit_scroller_2)
digit_scroller_3 = DigitScroller(Scroller_Digits=12, Scroller_Prefix="Digit Scroller", Scroller_Radix=11, Scroller_Value=5)
colour_swatch = ColourSwatch(SwatchColor=RGB(0, 244, 124))
subtraction_2 = Subtraction(A=digit_scroller_3, B="2")
fast_loop_start_2 = FastLoopStart(Iterations=subtraction_2, Data=fast_loop_end)  # -> port, Counter, Data
scale_8 = Scale(Geometry=fast_loop_start_2.Data, Center=Point(0, 0, 0), Factor=expr("1/3", 0.3333333333))  # -> Geometry, Transform
fast_loop_end_2 = FastLoopEnd(port=fast_loop_start_2.port, Exit=False, Data=scale_8.Geometry, RecordData=True, TimeOutVal=0)
merge_2 = Merge(Data1=fast_loop_end, Data2=fast_loop_end_2)
stroke_2 = Stroke(ShapeGeometry=merge_2, Color=colour_swatch, Weight=0, EndCap=2)
solid_fill_2 = SolidFill(ShapeGeometry=stroke_2, Color=colour_swatch)  # -> flatten(Shape)
merge_3 = Merge(Data1=solid_fill, Data2=solid_fill_2)
stream_filter_2 = StreamFilter(Gate=Slider(2, range=0..2), Stream0=solid_fill, Stream1=solid_fill_2, Stream2=merge_3)
data = Data(stream_filter_2)
shape_data = ShapeData(ShapeGeometry=data, ID=" ", Hover=False)
construct_drawing = ConstructDrawing(ShapesGeometry=flatten(shape_data), Boundary=bounding_rectangle, Width=power, Height=power, Color=RGBA(255, 255, 255, 0))  # -> Drawing, Boundary
save_svg = SaveSvg(DrawingsShapesGeometry=construct_drawing.Drawing, FolderPath="C:\", FileName="ϱvƨ", Save=False)
boundary_surfaces = BoundarySurfaces(Edges=merge_2)
custom_preview = CustomPreview(Geometry=boundary_surfaces, Material=colour_swatch)
drawing_viewer = DrawingViewer(DrawingsShapesGeometry=construct_drawing.Drawing, Resolution=96)
