# Grasshopper definition XHG.⠀⠀⠀⠀◯⠀ᙁᗩ✤ᑐᑕᗩᴥꗳ⠀◯⠀ᔓᔕⓄᴥᑐᑕ⠀◯⠀ᗱᗴИNᗩᙁߦ⠀◯⠀⠀⠀⠀ⵙ⠀⠀⠀⠀◯⠀ߦᙁᗩИNᗱᗴ⠀◯⠀ᑐᑕᴥⓄᔓᔕ⠀◯⠀ꗳᴥᗩᑐᑕ✤ᗩᙁ⠀◯⠀⠀⠀⠀.GHX (Grasshopper 1.0.7)
# plug-ins: Pancake, Anemone, Yellow, Pufferfish, IntraLattice

mesh_plane = MeshPlane(Boundary={Plane=PlaneXY(0, 0, 0), Size=Domain2(u=-0.5..0.5, v=-0.5..0.5)}, WidthCount=1, HeightCount=1)  # -> Mesh, Area
division = Division(A="1", B="3")
number_slider = Slider(7, range=0..7)
scale = Scale(Geometry=mesh_plane.Mesh, Center=Point(0, 0, 0), Factor=division)  # -> Geometry, Transform
loop_start = LoopStart(Repeat=number_slider, Trigger=[number_slider, Button()], Data=scale.Geometry)  # -> port, Counter, Data
mesh_join = MeshJoin(Meshes=loop_start.Data)
mesh_cull_duplicate_faces = MeshCullDuplicateFaces(Mesh=mesh_join)
division_2 = Division(A=division, B=2)
scale_2 = Scale(Geometry=mesh_cull_duplicate_faces, Center=Point(0, 0, 0), Factor=division)  # -> Geometry, Transform
vector_xyz = VectorXYZ(XComponent=0, YComponent=division, ZComponent=0)  # -> Vector, Length
negative = Negative(Value=division_2)
vector_xyz_2 = VectorXYZ(XComponent=negative, YComponent=0, ZComponent=0)  # -> Vector, Length
move = Move(Geometry=scale_2.Geometry, Motion=vector_xyz.Vector)  # -> Geometry, Transform
polar_array = PolarArray(Geometry=move.Geometry, Plane=PlaneXY(0, 0, 0), Count=4, Angle=6.283185307)  # -> Geometry, Transform
yz_plane = YZPlane(Origin=Point(0, 0, 0))
merge = Merge(Data1=mesh_cull_duplicate_faces, Data2=polar_array.Geometry)  # -> flatten(Result)
mesh_join_2 = MeshJoin(Meshes=merge)
mesh_cull_duplicate_faces_2 = MeshCullDuplicateFaces(Mesh=mesh_join_2)
plane_surface = PlaneSurface(Plane=yz_plane, XSize=Domain(-1, 1), YSize=Domain(-1, 1))
loop_end = LoopEnd(
    port=loop_start.port,
    Exit=False,
    Data=mesh_cull_duplicate_faces_2,
    TimeOutVal=0,
    pausedState=False,
    state="Constant output")  # -> flatten(Data)
move_2 = Move(Geometry=plane_surface, Motion=vector_xyz_2.Vector)  # -> flatten(Geometry), Transform
mesh_join_3 = MeshJoin(Meshes=loop_end)
deconstruct_mesh = DeconstructMesh(Mesh=merge)  # -> Vertices, flatten(Faces), Colours, Normals
plane_trim_mesh = PlaneTrimMesh(Mesh=mesh_join_3, Plane=move_2.Geometry, Flip=False, TrimType=1)  # -> Trimmed, Intersected
deconstruct_mesh_2 = DeconstructMesh(Mesh=loop_end)  # -> Vertices, flatten(Faces), Colours, Normals
rotate = Rotate(Geometry=move_2.Geometry, Angle=1.570796327, Plane=PlaneXY(0, 0, 0))  # -> Geometry, Transform
list_length = ListLength(List=deconstruct_mesh_2.Faces)
list_length_2 = ListLength(List=deconstruct_mesh.Faces)
plane_trim_mesh_2 = PlaneTrimMesh(Mesh=plane_trim_mesh.Trimmed, Plane=rotate.Geometry, Flip=False, TrimType=1)  # -> Trimmed, Intersected
rotate_2 = Rotate(Geometry=rotate.Geometry, Angle=1.570796327, Plane=PlaneXY(0, 0, 0))  # -> Geometry, Transform
panel = Panel(mesh_join_3)
division_3 = Division(A=list_length_2, B=list_length)
plane_trim_mesh_3 = PlaneTrimMesh(Mesh=plane_trim_mesh_2.Trimmed, Plane=rotate_2.Geometry, Flip=False, TrimType=1)  # -> Trimmed, Intersected
mesh_cull_duplicate_faces_3 = MeshCullDuplicateFaces(Mesh=plane_trim_mesh_3.Trimmed)
mesh_join_4 = MeshJoin(Meshes=plane_trim_mesh_3.Trimmed)
mesh_preview = MeshPreview(Mesh=mesh_join_3)
panel_2 = Panel(division_3)
export_as = ExportAs(
    Geometry=mesh_join_3,
    FileLocation="C:\JBO.OBJ",
    Overwrite=True,
    Export=Toggle(False),
    CompMode=True,
    CopyAttributes=False,
    LastSaveLocalization="neutral,N",
    RestoreState=False,
    TreatGhGeoAsRef=True)  # -> OK, ExportCommand
export_3dm = Export3DM(
    FileLocation="C:\MD3.3DM",
    Overwrite=True,
    Version=0,
    Export=False,
    LastSaveLocalization="neutral,N",
    TreatGhGeoAsRef=True)  # -> OK, Log
panel_3 = Panel(export_3dm.OK)
panel_4 = Panel(export_3dm.Log)
panel_5 = Panel(export_as.ExportCommand)
panel_6 = Panel(export_as.OK)
